# Grasshopper definition Slab.gh (Grasshopper 1.0.7)
# plug-ins: Alpaca4d, Kangaroo2 Components, LunchBox, BH.UI.Grasshopper

vector_xyz = VectorXYZ(XComponent="30", YComponent=0, ZComponent=0)  # -> Vector, Length
rectangle = Rectangle(Plane=vector_xyz.Vector, XSize="12", YSize="20", Radius=0)  # -> Rectangle, Length
rectangle_2 = Rectangle(Plane=PlaneXY(0, 0, 0), XSize="20", YSize="20", Radius=0)  # -> Rectangle, Length
mesh_plane = MeshPlane(Boundary=rectangle.Rectangle, WidthCount=10, HeightCount="20")  # -> Mesh, Area
negative = Negative(Value=Slider(2.32, range=1..5))
plate_fiber_section_alpaca4d = PlateFiberSectionAlpaca4d(Thickness=0.15)
meshcorners = MeshCorners(Mesh=mesh_plane.Mesh, Angle=2.35619449)
explode = Explode(Curve=rectangle_2.Rectangle, Recursive=True)  # -> Segments, Vertices
space_truss_structure_1 = SpaceTrussStructure1(Surface=rectangle_2.Rectangle, UDivisions=10, VDivisions=10, TrussDepth=negative)  # -> PrimaryLines, PrimaryLines_2, WebLines, StructureNodes
gravity_load_alpaca4d = GravityLoadAlpaca4d(TimeSeriesType="Constant", GFactor=9.81)
support_alpaca4d = SupportAlpaca4d(Point=meshcorners, Tx=True, Ty=True, Tz=True, Rx=True, Ry=True, Rz=True)
removeduplicatepts = RemoveDuplicatePts(Points=explode.Vertices, Tolerance=0.01)
uniaxial_material_elastic_alpaca4d = UniaxialMaterialElasticAlpaca4d()
asd_shellq4_alpaca4d = ASDShellQ4Alpaca4d(Mesh=mesh_plane.Mesh, Section=plate_fiber_section_alpaca4d)  # -> flatten(Element)
merge = Merge(
    Data1=space_truss_structure_1.PrimaryLines,
    Data2=space_truss_structure_1.PrimaryLines_2,
    Data3=space_truss_structure_1.WebLines)
circlecs_alpaca4d = CircleCSAlpaca4d(Diameter=0.15, Thickness=0.01, Material=uniaxial_material_elastic_alpaca4d)
negative_2 = Negative(Value="5000")
assemblemodel_alpaca4d = AssembleModelAlpaca4d(Element=asd_shellq4_alpaca4d, Support=support_alpaca4d, Load=gravity_load_alpaca4d, Tolerance=0.01)  # -> AlpacaModel, Mass
analysis_settings_alpaca4d = AnalysisSettingsAlpaca4d()
constant_time_series_alpaca4d = ConstantTimeSeriesAlpaca4d(LoadFactor=1)  # -> TimeSeries, Graph
unit_z = UnitZ(Factor=negative_2)
panel = Panel(analysis_settings_alpaca4d)
force_beam_column_alpaca4d = ForceBeamColumnAlpaca4d(Line=merge, Section=circlecs_alpaca4d)
run_analysis_alpaca4d = RunAnalysisAlpaca4d(AlpacaModel=assemblemodel_alpaca4d.AlpacaModel, Settings=analysis_settings_alpaca4d)  # -> Log, AlpacaModel
point_load_alpaca4d = PointLoadAlpaca4d(
    Point=space_truss_structure_1.StructureNodes,
    Force=unit_z,
    Moment=Vector(0, 0, 0),
    TimeSeries=constant_time_series_alpaca4d.TimeSeries)
support_alpaca4d_2 = SupportAlpaca4d(Point=removeduplicatepts, Tx=True, Ty=True, Tz=True, Rx=True, Ry=True, Rz=True)

cluster = Cluster(
    alpacamodel=run_analysis_alpaca4d.AlpacaModel,
    internal_force=1,
    lower_limit_multiplier=Slider(1, range=0..1),
    upper_limit_multiplier=Slider(1, range=0..1))  # -> mesh, min, max

colors_alpaca4d = ColorsAlpaca4d(GradientIndex=2)
assemblemodel_alpaca4d_2 = AssembleModelAlpaca4d(Element=force_beam_column_alpaca4d, Support=support_alpaca4d_2, Load=point_load_alpaca4d, Tolerance=0.01)  # -> AlpacaModel, Mass
deformed_model_view_alpaca4d = DeformedModelViewAlpaca4d(AlpacaModel=run_analysis_alpaca4d.AlpacaModel, Step=0, Scale=Slider(1, range=0.001..1), Colors=colors_alpaca4d)  # -> Line, Mesh, Brick
analysis_settings_alpaca4d_2 = AnalysisSettingsAlpaca4d()
run_analysis_alpaca4d_2 = RunAnalysisAlpaca4d(AlpacaModel=assemblemodel_alpaca4d_2.AlpacaModel, Settings=analysis_settings_alpaca4d_2)  # -> Log, AlpacaModel
value_list = ValueList({"Fx": 0, "Fy": 1, "Fxy": 2, "Mx": 3, "My": 4, "Mxy": 5, "Vxz": 6, "Vyz": 7}, selected="Mx")
value_list_2 = ValueList({"N": 0, "Vy": 1, "Vz": 2, "Mx": 3, "My": 4, "Mz": 5}, selected="N")
colors_alpaca4d_2 = ColorsAlpaca4d(GradientIndex=2)
alpacamodel = Data(run_analysis_alpaca4d_2.AlpacaModel)
alpacamodel_2 = Data(run_analysis_alpaca4d.AlpacaModel)
deformed_model_view_alpaca4d_2 = DeformedModelViewAlpaca4d(AlpacaModel=run_analysis_alpaca4d_2.AlpacaModel, Step=0, Scale=Slider(0.1, range=0.1..100), Colors=colors_alpaca4d_2)  # -> Line, Mesh, Brick
beam_forces_view_alpaca4d = BeamForcesViewAlpaca4d(alpacamodel=alpacamodel, internal_force=value_list_2, lower_limit_multiplier=0, upper_limit_multiplier=1)  # -> cluster_output, min, max
shell_forces_view_alpaca4d = ShellForcesViewAlpaca4d(
    alpacamodel=alpacamodel_2,
    internal_force=value_list,
    lower_limit_multiplier=Slider(1, range=0..1),
    upper_limit_multiplier=Slider(1, range=0..1))  # -> alpacamodel_2, mesh, min, max
explode_2 = Explode(Object=run_analysis_alpaca4d_2.AlpacaModel, Component="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")
mesh_join = MeshJoin(Meshes=deformed_model_view_alpaca4d_2.Line)
explode_3 = Explode(Object=explode_2, Component="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")  # -> Curve, Section, GeomTransf, BeamIntegration, LocalZAxis, Type, Id, INode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
beam_forces_alpaca4d = BeamForcesAlpaca4d(AlpacaModel=run_analysis_alpaca4d_2.AlpacaModel, History=False, Step=0)  # -> N, Vy, Vz, Mx, My, Mz
graft_tree = GraftTree(Tree=explode_3.GeomTransf, IncludeEmptyLists=True, IncludeNullItems=True)
explode_4 = Explode(Object=graft_tree, Component="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")  # -> Type, Line, Id, LocalZ, LocalY
range = Range(Domain=Domain(0, 1), Steps="4")
number = Number(flatten(beam_forces_alpaca4d.My))
evaluate_curve = EvaluateCurve(Curve=reparameterize(explode_4.Line), Parameter=range)  # -> Point, Tangent, Angle
bounds = Bounds(Numbers=flatten(number))
construct_plane = ConstructPlane(Origin=simplify(evaluate_curve.Point), XAxis=simplify(explode_4.LocalZ), YAxis=simplify(explode_4.LocalY))
deconstruct_domain = DeconstructDomain(Domain=bounds)  # -> Start, End
deconstruct_plane = DeconstructPlane(Plane=construct_plane)  # -> Origin, XAxis, YAxis, ZAxis
absolute = Absolute(Value=deconstruct_domain.Start)
absolute_2 = Absolute(Value=deconstruct_domain.End)
line_sdl = LineSDL(Start=deconstruct_plane.Origin, Direction=deconstruct_plane.XAxis, Length=1)
maximum = Maximum(A=absolute, B=absolute_2)
negative_3 = Negative(Value=maximum)
construct_domain = ConstructDomain(DomainStart=negative_3, DomainEnd=maximum)
remap_numbers = RemapNumbers(Value=number, Source=construct_domain, Target=Domain(0, 1))  # -> Mapped, Clipped

# ==== cluster Cluster
alpacamodel = ClusterInput()
internal_force = ClusterInput()
lower_limit_multiplier = ClusterInput()
upper_limit_multiplier = ClusterInput()
data = Data(alpacamodel)
shell_forces_alpaca4d = ShellForcesAlpaca4d(AlpacaModel=alpacamodel, History=False, Step=0)  # -> Fx, Fy, Fxy, Mx, My, Mxy, Vxz, Vyz
integer = Integer(internal_force)
ghpython_script = GhPythonScript(x=data)  # -> out, a
# ---------- ghpython_script: Python ----------
__author__ = "Marco"
__version__ = "2024.06.07"

import rhinoscriptsyntax as rs

a = x.Shells
# ---------- end ghpython_script ----------
ghpython_script_2 = GhPythonScript(x=ghpython_script.a)  # -> out, a
# ---------- ghpython_script_2: Python ----------
__author__ = "Marco"
__version__ = "2024.06.07"

import rhinoscriptsyntax as rs

a = x.Mesh
# ---------- end ghpython_script_2 ----------
ghpython_script_3 = GhPythonScript(x=integer)  # -> out, a
# ---------- ghpython_script_3: Python ----------
__author__ = "Marco"
__version__ = "2024.06.07"

import rhinoscriptsyntax as rs

a = "{" + "{0};?".format(x) + "}"
# ---------- end ghpython_script_3 ----------
entwine = Entwine(
    Branch0X=shell_forces_alpaca4d.Fx,
    Branch1X=shell_forces_alpaca4d.Fy,
    Branch2X=shell_forces_alpaca4d.Fxy,
    Branch3X=shell_forces_alpaca4d.Mx,
    Branch4X=shell_forces_alpaca4d.My,
    Branch5X=shell_forces_alpaca4d.Mxy,
    Branch6X=shell_forces_alpaca4d.Vxz,
    Branch7X=shell_forces_alpaca4d.Vyz,
    FlattenInputs=False)  # -> simplify(Result)
split_tree = SplitTree(Data=entwine, Masks=flatten(ghpython_script_3.a))  # -> Positive, Negative
average = Average(Input=split_tree.Positive)
number = Number(average)
bounds = Bounds(Numbers=flatten(number))
bounds_2 = Bounds(Numbers=flatten(number))
deconstruct_domain = DeconstructDomain(Domain=bounds)  # -> Start, End
deconstruct_domain_2 = DeconstructDomain(Domain=bounds_2)  # -> Start, End
graft_tree = GraftTree(Tree=ghpython_script_2.a, IncludeEmptyLists=True, IncludeNullItems=True)
min = ClusterOutput(deconstruct_domain.Start)
max = ClusterOutput(deconstruct_domain.End)
multiplication = Multiplication(A=deconstruct_domain_2.Start, B=lower_limit_multiplier)
multiplication_2 = Multiplication(A=deconstruct_domain_2.End, B=upper_limit_multiplier)
gradient = Gradient(
    LowerLimit=multiplication,
    UpperLimit=multiplication_2,
    Parameter=number,
    stops=[0: RGB(0, 0, 255), 0.25: RGB(100, 149, 237), 0.5: RGB(255, 255, 255), 0.75: RGB(220, 20, 60), 1: RGB(255, 0, 0)])
mesh_colours = MeshColours(Mesh=graft_tree, Colours=gradient)  # -> flatten(Mesh)
mesh_weldvertices = MeshWeldVertices(Mesh=mesh_colours, Tolerance=0.01)  # -> RuntimeMessage, Mesh
mesh = ClusterOutput(mesh_weldvertices.Mesh)

# ==== cluster BeamForcesViewAlpaca4d
internal_force = ClusterInput()  # 0-N, 1-Vy, 2-Vz, 3-Mx, 4-My, 5-Mz
lower_limit_multiplier = ClusterInput()
upper_limit_multiplier = ClusterInput()
alpacamodel = ClusterInput()
integer = Integer(internal_force)
beam_forces_alpaca4d = BeamForcesAlpaca4d(AlpacaModel=alpacamodel, History=False, Step=0)  # -> N, Vy, Vz, Mx, My, Mz
ghpython_script = GhPythonScript(x=alpacamodel)  # -> out, a
# ---------- ghpython_script: Python ----------
__author__ = "Marco"
__version__ = "2024.06.07"

import rhinoscriptsyntax as rs

a = x.Beams
# ---------- end ghpython_script ----------
entwine = Entwine(
    Branch0X=beam_forces_alpaca4d.N,
    Branch1X=beam_forces_alpaca4d.Vy,
    Branch2X=beam_forces_alpaca4d.Vz,
    Branch3X=beam_forces_alpaca4d.Mx,
    Branch4X=beam_forces_alpaca4d.My,
    Branch5X=beam_forces_alpaca4d.Mz,
    FlattenInputs=False)  # -> simplify(Result)
ghpython_script_2 = GhPythonScript(x=integer)  # -> out, a; same code as ghpython_script_3
ghpython_script_3 = GhPythonScript(x=ghpython_script.a)  # -> out, a
# ---------- ghpython_script_3: Python ----------
__author__ = "Marco"
__version__ = "2024.06.07"

import rhinoscriptsyntax as rs

a = x.Curve
# ---------- end ghpython_script_3 ----------
graft_tree = GraftTree(Tree=ghpython_script_3.a, IncludeEmptyLists=True, IncludeNullItems=True)
split_tree = SplitTree(Data=entwine, Masks=flatten(ghpython_script_2.a))  # -> Positive, Negative
list_length = ListLength(List=entwine)
range = Range(Domain=Domain(0, 1), Steps=list_length)
number = Number(split_tree.Positive)
shatter = Shatter(Curve=reparameterize(graft_tree), Parameters=range)  # -> simplify(Segments)
bounds = Bounds(Numbers=flatten(number))
deconstruct_domain = DeconstructDomain(Domain=bounds)  # -> Start, End
absolute = Absolute(Value=deconstruct_domain.Start)
absolute_2 = Absolute(Value=deconstruct_domain.End)
maximum = Maximum(A=absolute, B=absolute_2)
negative = Negative(Value=maximum)
absolute_3 = Absolute(Value=number)
construct_domain = ConstructDomain(DomainStart=negative, DomainEnd=maximum)
construct_domain_2 = ConstructDomain(DomainStart=lower_limit_multiplier, DomainEnd=upper_limit_multiplier)
bounds_2 = Bounds(Numbers=flatten(absolute_3))
deconstruct_domain_2 = DeconstructDomain(Domain=construct_domain_2)  # -> Start, End
remap_numbers = RemapNumbers(Value=number, Source=construct_domain, Target=construct_domain_2)  # -> Mapped, Clipped
remap_numbers_2 = RemapNumbers(Value=absolute_3, Source=bounds_2, Target="1 to 12")  # -> Mapped, Clipped
bounds_3 = Bounds(Numbers=flatten(number))
gradient = Gradient(
    LowerLimit=deconstruct_domain_2.Start,
    UpperLimit=deconstruct_domain_2.End,
    Parameter=remap_numbers.Mapped,
    stops=[0: RGB(0, 0, 255), 0.25: RGB(100, 149, 237), 0.5: RGB(255, 255, 255), 0.75: RGB(220, 20, 60), 1: RGB(255, 0, 0)])
deconstruct_domain_3 = DeconstructDomain(Domain=bounds_3)  # -> Start, End
cluster_output = ClusterOutput(alpacamodel)
min = ClusterOutput(deconstruct_domain_3.Start)
max = ClusterOutput(deconstruct_domain_3.End)
custom_preview_lineweights = CustomPreviewLineweights(Geometry=shatter, Shader=gradient, Thickness=remap_numbers_2.Mapped, Absolute=False)

# ==== cluster ShellForcesViewAlpaca4d
alpacamodel = ClusterInput()
lower_limit_multiplier = ClusterInput()
upper_limit_multiplier = ClusterInput()
internal_force = ClusterInput()  # 0-Fx, 1-Fy, 2-Fxy, 3-Mx, 4-My, 5-Mxy, 6-Vxz, 7-Vyz
data = Data(alpacamodel)
shell_forces_alpaca4d = ShellForcesAlpaca4d(AlpacaModel=alpacamodel, History=False, Step=0)  # -> Fx, Fy, Fxy, Mx, My, Mxy, Vxz, Vyz
ghpython_script = GhPythonScript(x=data)  # -> out, a; same code as ghpython_script
integer = Integer(internal_force)
ghpython_script_2 = GhPythonScript(x=ghpython_script.a)  # -> out, a; same code as ghpython_script_2
ghpython_script_3 = GhPythonScript(x=integer)  # -> out, a; same code as ghpython_script_3
entwine = Entwine(
    Branch0X=shell_forces_alpaca4d.Fx,
    Branch1X=shell_forces_alpaca4d.Fy,
    Branch2X=shell_forces_alpaca4d.Fxy,
    Branch3X=shell_forces_alpaca4d.Mx,
    Branch4X=shell_forces_alpaca4d.My,
    Branch5X=shell_forces_alpaca4d.Mxy,
    Branch6X=shell_forces_alpaca4d.Vxz,
    Branch7X=shell_forces_alpaca4d.Vyz,
    FlattenInputs=False)  # -> simplify(Result)
split_tree = SplitTree(Data=entwine, Masks=flatten(ghpython_script_3.a))  # -> Positive, Negative
average = Average(Input=split_tree.Positive)
number = Number(average)
bounds = Bounds(Numbers=flatten(number))
bounds_2 = Bounds(Numbers=flatten(number))
deconstruct_domain = DeconstructDomain(Domain=bounds)  # -> Start, End
deconstruct_domain_2 = DeconstructDomain(Domain=bounds_2)  # -> Start, End
graft_tree = GraftTree(Tree=ghpython_script_2.a, IncludeEmptyLists=True, IncludeNullItems=True)
min = ClusterOutput(deconstruct_domain.Start)
max = ClusterOutput(deconstruct_domain.End)
multiplication = Multiplication(A=deconstruct_domain_2.Start, B=lower_limit_multiplier)
multiplication_2 = Multiplication(A=deconstruct_domain_2.End, B=upper_limit_multiplier)
gradient = Gradient(
    LowerLimit=multiplication,
    UpperLimit=multiplication_2,
    Parameter=number,
    stops=[0: RGB(0, 0, 255), 0.25: RGB(100, 149, 237), 0.5: RGB(255, 255, 255), 0.75: RGB(220, 20, 60), 1: RGB(255, 0, 0)])
mesh_colours = MeshColours(Mesh=graft_tree, Colours=gradient)  # -> flatten(Mesh)
mesh_weldvertices = MeshWeldVertices(Mesh=mesh_colours, Tolerance=0.01)  # -> RuntimeMessage, Mesh
mesh = ClusterOutput(mesh_weldvertices.Mesh)
alpacamodel_2 = ClusterOutput(alpacamodel)
