# Grasshopper definition Bridge_beam.gh (Grasshopper 1.0.7)
# plug-ins: Alpaca4d

genes = GenePool(Decimals=2, Maximum=1, Minimum=0, Value=[0, 0.2, 0.33, 0.53, 0.71, 0.87, 0.94, 1])
crv = Curve(<curve referenced from the Rhino model>)
eval = EvaluateCurve(Curve=reparameterize(crv), Parameter=genes)  # -> Point, Tangent, Angle
shatter = Shatter(Curve=reparameterize(crv), Parameters=genes)
project = Project(Geometry=eval.Point, Plane=PlaneXY(0, 0, 0))  # -> Geometry, Transform
pt = Point(project.Geometry)
pt_2 = Point(eval.Point)
divide = DivideCurve(Curve=shatter, Count=Slider(15, range=0..100), Kinks=False)  # -> Points, Tangents, Parameters
ln = Line(StartPoint=pt, EndPoint=pt_2)
pline = PolyLine(Vertices=divide.Points, Closed=False)
explode = Explode(Curve=pline, Recursive=True)  # -> Segments, Vertices

cullpt = CullDuplicates(Points=flatten(explode.Vertices), Tolerance=0.1, CullMode=3)  # -> Points, Indices, Valence
lng = ListLength(List=cullpt.Points)
sort_pt = SortPoints(Points=cullpt.Points)  # -> Points, Indices
panel = Panel(lng)
item = ListItem(List=sort_pt.Points, Index=Slider(6, range=0..41), Wrap=True)
pt_3 = Point(pt)
toggle = BooleanToggle(True)
division = Division(A="39000", B="2")
vec = VectorXYZ(XComponent="0", YComponent=0, ZComponent="-400")  # -> Vector, Length
uniaxialmaterial = UniaxialMaterialAlpaca4d(MatName="cls", E="39000", G=division, V=0.3, MarshallingSignalParameter="25", MarshallingSignalParameter_2=23.5)
point_load = PointLoadAlpaca4d(Force=vec.Vector, Pos=item)
support = SupportAlpaca4d(Pos=pt_3, Tx=toggle, Ty=toggle, Tz=toggle, Rx=toggle, Ry=toggle, Rz=toggle)
division_2 = Division(A="2500", B="2")
circular_cross_section = CircularCrossSectionAlpaca4d(MarshallingSignalParameter="Circular", Diameter="2500", Thickness=division_2, UniaxialMaterial=uniaxialmaterial)
rectangular_hollow_section = RectangularHollowSectionAlpaca4d(SectionName="U", Base="2500", Height="7000", Thickness="400", UniaxialMaterial=uniaxialmaterial)

# ---- group: Column
line_to_beam = LineToBeamAlpaca4d(Line=ln, MarshallingSignalParameter=ColourSwatch(SwatchColor=RGB(0, 107, 237)), CrossSection=circular_cross_section)

# ----
line_to_beam_2 = LineToBeamAlpaca4d(
    Line=explode.Segments,
    MarshallingSignalParameter=ColourSwatch(SwatchColor=RGB(0, 237, 40)),
    CrossSection=rectangular_hollow_section)
merge = Merge(Data1=line_to_beam_2, Data2=line_to_beam)
assemble_model = AssembleModelAlpaca4d(Element=flatten(merge), Support=flatten(support), Load=flatten(point_load))  # -> AlpacaModel, MassOfStructure
static_analyses = StaticAnalysesAlpaca4d(AlpacaModel=assemble_model.AlpacaModel)
visualise_model = VisualiseModelAlpaca4d(AlpacaModel=assemble_model.AlpacaModel, Model=Toggle(True), Load=Toggle(True))  # -> AlpacaModel, Model
geo = Geometry(visualise_model.Model)

merge_2 = Merge(
    Data1=ColourSwatch(SwatchColor=RGB(233, 0, 237)),
    Data2=ColourSwatch(SwatchColor=RGB(237, 0, 0)),
    Data3=ColourSwatch(SwatchColor=RGB(237, 130, 0)),
    Data4=ColourSwatch(SwatchColor=RGB(233, 237, 0)),
    Data5=ColourSwatch(SwatchColor=RGB(0, 237, 28)),
    Data6=ColourSwatch(SwatchColor=RGB(0, 237, 237)),
    Data7=ColourSwatch(SwatchColor=RGB(20, 0, 237)))  # -> reverse(Result)
static_model_view = StaticModelViewAlpaca4d(AlpacaStaticOutput=static_analyses, Scale="1000", ModelExtrude=Toggle(True), ColorList=merge_2)  # -> ModelDisp, DisplacementRange
geo_2 = Geometry(static_model_view.ModelDisp)
