# Grasshopper definition VoltaBeam_staticAnalysis.gh (Grasshopper 1.0.7)
# plug-ins: Kangaroo Components, Alpaca4d

uniaxialmaterial_alpaca4d = UniaxialMaterialAlpaca4d(MatName="S235", E=210000, V=0.3, MarshallingSignalParameter=78.5, MarshallingSignalParameter_2=23.5)
circular_cross_section_alpaca4d = CircularCrossSectionAlpaca4d(MarshallingSignalParameter="Circular", Diameter="300", Thickness="10", UniaxialMaterial=uniaxialmaterial_alpaca4d)
boolean_toggle = BooleanToggle(True)
boolean_toggle_2 = BooleanToggle(False)
vector_xyz = VectorXYZ(XComponent="0", YComponent=0, ZComponent="-40")  # -> Vector, Length

mesh = Mesh(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)
refine = Refine(Mesh=mesh, Level=1)
mesh_edges = MeshEdges(Mesh=refine)  # -> NakedEdges, InteriorEdges, NonManifoldEdges
deconstruct_mesh = DeconstructMesh(Mesh=refine)  # -> Vertices, Faces, Colours, Normals

curve = Curve([mesh_edges.InteriorEdges, mesh_edges.NakedEdges])

curve_beam = Curve(curve)

removeduplicatepts = RemoveDuplicatePts(Points=flatten(deconstruct_mesh.Vertices), Tolerance=0.01)
deconstruct = Deconstruct(Point=removeduplicatepts)  # -> XComponent, YComponent, ZComponent
equality = Equality(FirstNumber=deconstruct.ZComponent, SecondNumber="0")  # -> Equality, Inequality
dispatch = Dispatch(List=removeduplicatepts, DispatchPattern=equality.Equality)  # -> ListA, ListB
point = Point(dispatch.ListA)
line_to_beam_alpaca4d = LineToBeamAlpaca4d(
    Line=curve_beam,
    MarshallingSignalParameter=ColourSwatch(SwatchColor=RGB(0, 237, 40)),
    CrossSection=circular_cross_section_alpaca4d)
point_load_alpaca4d = PointLoadAlpaca4d(Force=vector_xyz.Vector, Pos=dispatch.ListB)
support_alpaca4d = SupportAlpaca4d(
    Pos=point,
    Tx=boolean_toggle,
    Ty=boolean_toggle,
    Tz=boolean_toggle,
    Rx=boolean_toggle_2,
    Ry=boolean_toggle_2,
    Rz=boolean_toggle)
assemble_model_alpaca_4d = AssembleModelAlpaca4d(Element=flatten(line_to_beam_alpaca4d), Support=flatten(support_alpaca4d), Load=flatten(point_load_alpaca4d))  # -> AlpacaModel, MassOfStructure
static_analyses_alpaca4d = StaticAnalysesAlpaca4d(AlpacaModel=assemble_model_alpaca_4d.AlpacaModel)
visualise_model_alpaca4d = VisualiseModelAlpaca4d(AlpacaModel=assemble_model_alpaca_4d.AlpacaModel, Model=Toggle(True), Support=Toggle(True), Load=Toggle(False))  # -> AlpacaModel, Model

merge = Merge(
    Data1=ColourSwatch(SwatchColor=RGB(233, 0, 237)),
    Data2=ColourSwatch(SwatchColor=RGB(237, 0, 0)),
    Data3=ColourSwatch(SwatchColor=RGB(237, 130, 0)),
    Data4=ColourSwatch(SwatchColor=RGB(233, 237, 0)),
    Data5=ColourSwatch(SwatchColor=RGB(0, 237, 28)),
    Data6=ColourSwatch(SwatchColor=RGB(0, 237, 237)),
    Data7=ColourSwatch(SwatchColor=RGB(20, 0, 237)))  # -> reverse(Result)
static_model_view_alpaca4d = StaticModelViewAlpaca4d(AlpacaStaticOutput=static_analyses_alpaca4d, Scale="50", ModelExtrude=Toggle(False), ColorList=merge)  # -> ModelDisp, DisplacementRange
geometry = Geometry(static_model_view_alpaca4d.ModelDisp)

beam_force_diagram_alpaca4d = BeamForceDiagramAlpaca4d(AlpacaStaticOutput=static_analyses_alpaca4d, SectionForces="N")
beam_displacement_alpaca4d = BeamDisplacementAlpaca4d(AlpacaStaticOutput=static_analyses_alpaca4d)  # -> TagElement, LocalTrans, LocalRot, GlobalTrans, GlobalRot
reaction_forces_alpaca4d = ReactionForcesAlpaca4d(AlpacaStaticOutput=static_analyses_alpaca4d)  # -> TagPoints, ReactionForce, ReactionMoment
node_displacement_alpaca4d = NodeDisplacementAlpaca4d(AlpacaStaticOutput=static_analyses_alpaca4d)  # -> Points, Trans, Rot
