# Grasshopper definition VoltaShell_staticAnalysis.gh (Grasshopper 1.0.7)
# plug-ins: Kangaroo Components, Alpaca4d

# ---- group: Element
data = Data(0)
data_2 = Data(0)

# ---- group: Load
# instagram:    Alpaca4d
# facebook:     Alpaca4d
# mail:         alpaca4d@gmail.com
data_3 = Data(0)
data_4 = Data(0)

# ---- group: Cross-Section
data_5 = Data(0)
data_6 = Data(0)

# ---- group: Support
data_7 = Data(0)
data_8 = Data(0)

# ----
mesh = Mesh(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)
refine = Refine(Mesh=mesh, Level=1)
deconstruct_mesh = DeconstructMesh(Mesh=refine)  # -> Vertices, Faces, Colours, Normals

# ---- group: Material
data_9 = Data(0)
data_10 = Data(0)

# ---- group: Constraint
data_11 = Data(0)
data_12 = Data(0)

# ----
removeduplicatepts = RemoveDuplicatePts(Points=flatten(deconstruct_mesh.Vertices), Tolerance=0.01)
deconstruct = Deconstruct(Point=removeduplicatepts)  # -> XComponent, YComponent, ZComponent
equality = Equality(FirstNumber=deconstruct.ZComponent, SecondNumber="0")  # -> Equality, Inequality
dispatch = Dispatch(List=removeduplicatepts, DispatchPattern=equality.Equality)  # -> ListA, ListB
division = Division(A="39000", B="2")
point = Point(dispatch.ListA)
ndmaterial_alpaca4d = NDMaterialAlpaca4d(MatName="S235", E="39000", G=division, V=0.3, Rho="25", Fy=23.5)
shell_section_alpaca4d = ShellSectionAlpaca4d(SectionName="Cls", Thickness="300", NDMaterial=ndmaterial_alpaca4d)
boolean_toggle = BooleanToggle(True)
boolean_toggle_2 = BooleanToggle(False)
vector_xyz = VectorXYZ(XComponent="0", YComponent=0, ZComponent="-40")  # -> Vector, Length
mesh_to_shell_alpaca4d = MeshToShellAlpaca4d(Mesh=refine, Colour=ColourSwatch(SwatchColor=RGB(0, 91, 237)), CrossSection=shell_section_alpaca4d)
point_load_alpaca4d = PointLoadAlpaca4d(Force=vector_xyz.Vector, Pos=dispatch.ListB)
support_alpaca4d = SupportAlpaca4d(
    Pos=point,
    Tx=boolean_toggle,
    Ty=boolean_toggle,
    Tz=boolean_toggle,
    Rx=boolean_toggle_2,
    Ry=boolean_toggle_2,
    Rz=boolean_toggle)
assemble_model_alpaca_4d = AssembleModelAlpaca4d(Element=flatten(mesh_to_shell_alpaca4d), Support=flatten(support_alpaca4d), Load=flatten(point_load_alpaca4d))  # -> AlpacaModel, MassOfStructure
static_analyses_alpaca4d = StaticAnalysesAlpaca4d(AlpacaModel=assemble_model_alpaca_4d.AlpacaModel)
visualise_model_alpaca4d = VisualiseModelAlpaca4d(AlpacaModel=assemble_model_alpaca_4d.AlpacaModel, Model=Toggle(True), Support=Toggle(True), Load=Toggle(False))  # -> AlpacaModel, Model

merge = Merge(
    Data1=ColourSwatch(SwatchColor=RGB(233, 0, 237)),
    Data2=ColourSwatch(SwatchColor=RGB(237, 0, 0)),
    Data3=ColourSwatch(SwatchColor=RGB(237, 130, 0)),
    Data4=ColourSwatch(SwatchColor=RGB(233, 237, 0)),
    Data5=ColourSwatch(SwatchColor=RGB(0, 237, 28)),
    Data6=ColourSwatch(SwatchColor=RGB(0, 237, 237)),
    Data7=ColourSwatch(SwatchColor=RGB(20, 0, 237)))  # -> reverse(Result)
static_model_view_alpaca4d = StaticModelViewAlpaca4d(AlpacaStaticOutput=static_analyses_alpaca4d, Scale="50", ModelExtrude=Toggle(False), ColorList=merge)  # -> ModelDisp, DisplacementRange
geometry = Geometry(static_model_view_alpaca4d.ModelDisp)

reaction_forces_alpaca4d = ReactionForcesAlpaca4d(AlpacaStaticOutput=static_analyses_alpaca4d)  # -> TagPoints, ReactionForce, ReactionMoment
node_displacement_alpaca4d = NodeDisplacementAlpaca4d(AlpacaStaticOutput=static_analyses_alpaca4d)  # -> Points, Trans, Rot
shell_stress_alpaca4d = ShellStressAlpaca4d(AlpacaStaticOutput=static_analyses_alpaca4d, StressView=Slider(1, range=0..10), ColorList=merge)  # -> Shell, StressValue, StressRange
