# Grasshopper definition palazzina_modalAnalysis.gh (Grasshopper 1.0.7)
# plug-ins: Kangaroo Components, Alpaca4d

curve_beam = Curve([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])
curve_truss = Curve([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])

# ---- group: Element
data = Data(0)
data_2 = Data(0)

# ---- group: Load
# instagram:    Alpaca4d
# facebook:     Alpaca4d
# mail:         alpaca4d@gmail.com
data_3 = Data(0)
data_4 = Data(0)

# ---- group: Cross-Section
data_5 = Data(0)
data_6 = Data(0)

# ---- group: Support
data_7 = Data(0)
data_8 = Data(0)

# ---- group: Material
data_9 = Data(0)
data_10 = Data(0)

# ---- group: Constraint
data_11 = Data(0)
data_12 = Data(0)

# ----
merge = Merge(Data1=curve_beam, Data2=curve_truss)
explode = Explode(Curve=merge, Recursive=True)  # -> Segments, Vertices
removeduplicatepts = RemoveDuplicatePts(Points=flatten(explode.Vertices), Tolerance=0.01)
uniaxialmaterial_alpaca4d = UniaxialMaterialAlpaca4d(MatName="S235", E=210000, V=0.3, MarshallingSignalParameter=78.5, MarshallingSignalParameter_2=23.5)
deconstruct = Deconstruct(Point=removeduplicatepts)  # -> XComponent, YComponent, ZComponent
equality = Equality(FirstNumber=deconstruct.ZComponent, SecondNumber="0")  # -> Equality, Inequality
circular_cross_section_alpaca4d = CircularCrossSectionAlpaca4d(MarshallingSignalParameter="Circular", Diameter="300", Thickness="10", UniaxialMaterial=uniaxialmaterial_alpaca4d)
double_t_section_alpaca4d = DoubleTSectionAlpaca4d(
    MarshallingSignalParameter="IPE",
    Bsup="400",
    Binf="400",
    H="400",
    Tsup="20",
    Tinf="20",
    Tw="20",
    MarshallingSignalParameter_2=uniaxialmaterial_alpaca4d)
dispatch = Dispatch(List=removeduplicatepts, DispatchPattern=equality.Equality)  # -> ListA, ListB
point = Point(dispatch.ListA)

# ---- group: Truss
line_to_beam_alpaca4d = LineToBeamAlpaca4d(
    Line=curve_truss,
    MarshallingSignalParameter=ColourSwatch(SwatchColor=RGB(0, 107, 237)),
    CrossSection=circular_cross_section_alpaca4d,
    MarshallingSignalParameter_2=Toggle(False))

# ----
line_to_beam_alpaca4d_2 = LineToBeamAlpaca4d(
    Line=curve_beam,
    MarshallingSignalParameter=ColourSwatch(SwatchColor=RGB(0, 237, 40)),
    CrossSection=double_t_section_alpaca4d)
boolean_toggle = BooleanToggle(True)
mass_point_alpaca4d = MassPointAlpaca4d(NodalMass="500", Pos=dispatch.ListB)
support_alpaca4d = SupportAlpaca4d(
    Pos=point,
    Tx=boolean_toggle,
    Ty=boolean_toggle,
    Tz=boolean_toggle,
    Rx=boolean_toggle,
    Ry=boolean_toggle,
    Rz=boolean_toggle)
merge_2 = Merge(Data1=line_to_beam_alpaca4d_2, Data2=line_to_beam_alpaca4d)
assemble_model_alpaca_4d = AssembleModelAlpaca4d(Element=flatten(merge_2), Support=flatten(support_alpaca4d), Mass=flatten(mass_point_alpaca4d))  # -> AlpacaModel, MassOfStructure
visualise_model_alpaca4d = VisualiseModelAlpaca4d(AlpacaModel=assemble_model_alpaca_4d.AlpacaModel, Model=Toggle(True), Load=Toggle(False))  # -> AlpacaModel, Model
modal_analyses_alpaca4d = ModalAnalysesAlpaca4d(AlpacaModel=assemble_model_alpaca_4d.AlpacaModel, NumVibrationModes="12")  # -> AlpacaModalOutput, Frequency, Period
panel = Panel(modal_analyses_alpaca4d.Period)

merge_3 = Merge(
    Data1=ColourSwatch(SwatchColor=RGB(233, 0, 237)),
    Data2=ColourSwatch(SwatchColor=RGB(237, 0, 0)),
    Data3=ColourSwatch(SwatchColor=RGB(237, 130, 0)),
    Data4=ColourSwatch(SwatchColor=RGB(233, 237, 0)),
    Data5=ColourSwatch(SwatchColor=RGB(0, 237, 28)),
    Data6=ColourSwatch(SwatchColor=RGB(0, 237, 237)),
    Data7=ColourSwatch(SwatchColor=RGB(20, 0, 237)))  # -> reverse(Result)

modal_model_view = ModalModelViewAlpaca4d(
    AlpacaModalOutput=modal_analyses_alpaca4d.AlpacaModalOutput,
    NumberMode=Slider(1, range=1..20),
    Speed="1",
    Animate=Toggle(False),
    Reset=Button(),
    Scale="5",
    ModelExtrude=Toggle(False),
    ColorList=merge_3)
geometry = Geometry(modal_model_view)
