# Grasshopper definition trave_su_appoggi.gh (Grasshopper 1.0.7)
# plug-ins: Alpaca4d

# ---- group: Geometry
construct_point = ConstructPoint(XCoordinate=0, YCoordinate=0, ZCoordinate=0)
series = Series(Start=0, Step="5", Count=Slider(4, range=0..100))
unit_x = UnitX(Factor=series)
move = Move(Geometry=construct_point, Motion=unit_x)  # -> Geometry, Transform
polyline = PolyLine(Vertices=move.Geometry, Closed=False)
explode = Explode(Curve=polyline, Recursive=True)  # -> Segments, Vertices

# ----
curve = Curve([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])
curve_2 = Curve([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])
uniaxialmaterial_alpaca4d = UniaxialMaterialAlpaca4d(MatName="Concrete", E=210000, V=0.3, MarshallingSignalParameter=78.5, MarshallingSignalParameter_2=23.5)
double_t_section_alpaca4d = DoubleTSectionAlpaca4d(
    MarshallingSignalParameter="IPE",
    Bsup="400",
    Binf="400",
    H="1000",
    Tsup="20",
    Tinf="20",
    Tw="20",
    MarshallingSignalParameter_2=uniaxialmaterial_alpaca4d)
vector_xyz = VectorXYZ(XComponent=0, YComponent="-300", ZComponent=0)  # -> Vector, Length
boolean_toggle = BooleanToggle(False)
boolean_toggle_2 = BooleanToggle(True)
line_to_beam_alpaca4d = LineToBeamAlpaca4d(
    Line=explode.Segments,
    MarshallingSignalParameter=ColourSwatch(SwatchColor=RGB(0, 237, 40)),
    CrossSection=double_t_section_alpaca4d)
linear_load_alpaca4d = LinearLoadAlpaca4d(Force=vector_xyz.Vector, Element=explode.Segments, Orientation="1")
support_alpaca4d = SupportAlpaca4d(
    Pos=explode.Vertices,
    Tx=boolean_toggle_2,
    Ty=boolean_toggle_2,
    Tz=boolean_toggle_2,
    Rx=boolean_toggle_2,
    Ry=boolean_toggle,
    Rz=boolean_toggle)
assemble_model_alpaca_4d = AssembleModelAlpaca4d(Element=flatten(line_to_beam_alpaca4d), Support=flatten(support_alpaca4d), Load=flatten(linear_load_alpaca4d))  # -> AlpacaModel, MassOfStructure
static_analyses_alpaca4d = StaticAnalysesAlpaca4d(AlpacaModel=assemble_model_alpaca_4d.AlpacaModel)
visualise_model_alpaca4d = VisualiseModelAlpaca4d(AlpacaModel=assemble_model_alpaca_4d.AlpacaModel, Model=Toggle(True))  # -> AlpacaModel, Model
merge = Merge(
    Data1=ColourSwatch(SwatchColor=RGB(233, 0, 237)),
    Data2=ColourSwatch(SwatchColor=RGB(237, 0, 0)),
    Data3=ColourSwatch(SwatchColor=RGB(237, 130, 0)),
    Data4=ColourSwatch(SwatchColor=RGB(233, 237, 0)),
    Data5=ColourSwatch(SwatchColor=RGB(0, 237, 28)),
    Data6=ColourSwatch(SwatchColor=RGB(0, 237, 237)),
    Data7=ColourSwatch(SwatchColor=RGB(20, 0, 237)))
static_model_view_alpaca4d = StaticModelViewAlpaca4d(
    MarshallingSignalParameter=static_analyses_alpaca4d,
    Scale="50000",
    ModelExtrud=Toggle(False),
    Direction="3",
    ColorList=merge)  # -> ModelDisp, DomainValues
beam_forces_diagram_alpaca4d = BeamForcesDiagramAlpaca4d(MarshallingSignalParameter=static_analyses_alpaca4d, SectionForces="M2", Scale="0.005")
