# Grasshopper definition 0_MultiSpanBeams.gh (Grasshopper 1.0.7)
# plug-ins: Alpaca4d

# ---- group: Element
data = Data(0)
data_2 = Data(0)

# ---- group: Load
# instagram:    Alpaca4d
# facebook:     Alpaca4d
# mail:         alpaca4d@gmail.com
data_3 = Data(0)
data_4 = Data(0)

# ---- group: Cross-Section
data_5 = Data(0)
data_6 = Data(0)

# ---- group: Support
data_7 = Data(0)
data_8 = Data(0)

# ---- group: Geometry
construct_point = ConstructPoint(XCoordinate=0, YCoordinate=0, ZCoordinate=0)
unit_x = UnitX(Factor=Slider(8, range=0..15))
move = Move(Geometry=construct_point, Motion=unit_x)  # -> Geometry, Transform

# ---- group: Material
data_9 = Data(0)
data_10 = Data(0)

# ---- group: Constraint
data_11 = Data(0)
data_12 = Data(0)

# ----
ln = Line(StartPoint=construct_point, EndPoint=move.Geometry)
genes = GenePool(Decimals=2, Maximum=1, Minimum=0, Value=[0.2010812835, 0.4448275643, 0.8612168584])
shatter = Shatter(Curve=ln, Parameters=genes)
explode = Explode(Curve=shatter, Recursive=True)  # -> flatten(Segments), Vertices
panel = Panel("Concrete")  # disabled
uniaxialmaterial_alpaca4d = UniaxialMaterialAlpaca4d(MatName=panel, E=210000, V=0.3, MarshallingSignalParameter=78.5, MarshallingSignalParameter_2=23.5)  # disabled
panel_2 = Panel("IPE")  # disabled
panel_3 = Panel("1000")  # disabled
panel_4 = Panel("400")  # disabled
panel_5 = Panel("20")  # disabled
double_t_section_alpaca4d = DoubleTSectionAlpaca4d(
    MarshallingSignalParameter=panel_2,
    Bsup=panel_4,
    Binf=panel_4,
    H=panel_3,
    Tsup=panel_5,
    Tinf=panel_5,
    Tw=panel_5,
    MarshallingSignalParameter_2=uniaxialmaterial_alpaca4d)  # disabled
cullpt = CullDuplicates(Points=flatten(explode.Vertices), Tolerance=0.1, CullMode=1)  # -> Points, Indices, Valence
panel_6 = Panel("-300")  # disabled
vector_xyz = VectorXYZ(XComponent=0, YComponent=panel_6, ZComponent=0)  # -> Vector, Length; disabled
crv = Curve(explode.Segments)
pt = Point(cullpt.Points)
boolean_toggle = BooleanToggle(True)  # disabled
boolean_toggle_2 = BooleanToggle(False)  # disabled
colour_swatch = ColourSwatch(SwatchColor=RGB(0, 237, 40))  # disabled
panel_7 = Panel("1")  # disabled
line_to_beam_alpaca4d = LineToBeamAlpaca4d(Line=crv, MarshallingSignalParameter=colour_swatch, CrossSection=double_t_section_alpaca4d)  # disabled
linear_load_alpaca4d = LinearLoadAlpaca4d(Force=vector_xyz.Vector, Element=explode.Segments, Orientation=panel_7)  # disabled
support_alpaca4d = SupportAlpaca4d(
    Pos=pt,
    Tx=boolean_toggle,
    Ty=boolean_toggle,
    Tz=boolean_toggle,
    Rx=boolean_toggle,
    Ry=boolean_toggle_2,
    Rz=boolean_toggle_2)  # disabled
assemble_model_alpaca_4d = AssembleModelAlpaca4d(Element=flatten(line_to_beam_alpaca4d), Support=flatten(support_alpaca4d), Load=flatten(linear_load_alpaca4d))  # -> AlpacaModel, MassOfStructure; disabled
boolean_toggle_3 = BooleanToggle(True)  # disabled
static_analyses_alpaca4d = StaticAnalysesAlpaca4d(AlpacaModel=assemble_model_alpaca_4d.AlpacaModel)  # disabled
visualise_model_alpaca4d = VisualiseModelAlpaca4d(AlpacaModel=assemble_model_alpaca_4d.AlpacaModel, Model=boolean_toggle_3)  # -> AlpacaModel, Model; disabled
colour_swatch_2 = ColourSwatch(SwatchColor=RGB(233, 0, 237))  # disabled
colour_swatch_3 = ColourSwatch(SwatchColor=RGB(237, 0, 0))  # disabled
colour_swatch_4 = ColourSwatch(SwatchColor=RGB(237, 130, 0))  # disabled
colour_swatch_5 = ColourSwatch(SwatchColor=RGB(233, 237, 0))  # disabled
colour_swatch_6 = ColourSwatch(SwatchColor=RGB(0, 237, 28))  # disabled
colour_swatch_7 = ColourSwatch(SwatchColor=RGB(0, 237, 237))  # disabled
colour_swatch_8 = ColourSwatch(SwatchColor=RGB(20, 0, 237))  # disabled
boolean_toggle_4 = BooleanToggle(False)  # disabled
panel_8 = Panel("50000")  # disabled
panel_9 = Panel("3")  # disabled
merge = Merge(
    Data1=colour_swatch_2,
    Data2=colour_swatch_3,
    Data3=colour_swatch_4,
    Data4=colour_swatch_5,
    Data5=colour_swatch_6,
    Data6=colour_swatch_7,
    Data7=colour_swatch_8)  # disabled
panel_10 = Panel("0.005")  # disabled
panel_11 = Panel("M2")  # disabled
