# Grasshopper definition 3_MultiStoreyBuilding_ModalAnalysis.gh (Grasshopper 1.0.7)
# plug-ins: Kangaroo Components, Alpaca4d

# ---- group: Element
data = Data(0)
data_2 = Data(0)

# ---- group: Load
# instagram:    Alpaca4d
# facebook:     Alpaca4d
# mail:         alpaca4d@gmail.com
data_3 = Data(0)
data_4 = Data(0)

# ---- group: Cross-Section
data_5 = Data(0)
data_6 = Data(0)

# ---- group: Support
data_7 = Data(0)
data_8 = Data(0)

# ---- group: Material
data_9 = Data(0)
data_10 = Data(0)

# ---- group: Constraint
data_11 = Data(0)
data_12 = Data(0)

# ---- group: Model
curve_truss = Curve([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])
curve_beam = Curve([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])
merge = Merge(Data1=curve_beam, Data2=curve_truss)
explode = Explode(Curve=merge, Recursive=True)  # -> Segments, Vertices
removeduplicatepts = RemoveDuplicatePts(Points=flatten(explode.Vertices), Tolerance=0.01)
deconstruct = Deconstruct(Point=removeduplicatepts)  # -> XComponent, YComponent, ZComponent
equality = Equality(FirstNumber=deconstruct.ZComponent, SecondNumber="0")  # -> Equality, Inequality
dispatch = Dispatch(List=removeduplicatepts, DispatchPattern=equality.Equality)  # -> ListA, ListB

# ----
dash = DashPattern(Curve=[curve_beam, curve_truss], Pattern=Slider(0.3, range=0..1))  # -> Dashes, Gaps

# ---- group: Material
uniaxialmaterial_alpaca4d = UniaxialMaterialAlpaca4d(MatName="S235", E=210000, V=0.3, MarshallingSignalParameter=78.5, MarshallingSignalParameter_2=23.5)

# ---- group: Cross-Section
double_t_section_alpaca4d = DoubleTSectionAlpaca4d(
    MarshallingSignalParameter="IPE",
    Bsup="400",
    Binf="400",
    H="400",
    Tsup="20",
    Tinf="20",
    Tw="20",
    MarshallingSignalParameter_2=uniaxialmaterial_alpaca4d)

circular_cross_section_alpaca4d = CircularCrossSectionAlpaca4d(MarshallingSignalParameter="Circular", Diameter="300", Thickness="10", UniaxialMaterial=uniaxialmaterial_alpaca4d)

# ---- group: Support
point = Point(dispatch.ListA)
boolean_toggle = BooleanToggle(True)
support_alpaca4d = SupportAlpaca4d(
    Pos=point,
    Tx=boolean_toggle,
    Ty=boolean_toggle,
    Tz=boolean_toggle,
    Rx=boolean_toggle,
    Ry=boolean_toggle,
    Rz=boolean_toggle)

# ---- group: Element
line_to_beam_alpaca4d = LineToBeamAlpaca4d(
    Line=curve_truss,
    MarshallingSignalParameter=ColourSwatch(SwatchColor=RGB(0, 107, 237)),
    CrossSection=circular_cross_section_alpaca4d,
    MarshallingSignalParameter_2=Toggle(False))

line_to_beam_alpaca4d_2 = LineToBeamAlpaca4d(
    Line=curve_beam,
    MarshallingSignalParameter=ColourSwatch(SwatchColor=RGB(0, 237, 40)),
    CrossSection=double_t_section_alpaca4d)

# ---- group: Load
mass_point = MassPointAlpaca4d(NodalMass="30", Pos=dispatch.ListB)

# ----
merge_2 = Merge(Data1=line_to_beam_alpaca4d_2, Data2=line_to_beam_alpaca4d)
assemble_model_alpaca_4d = AssembleModelAlpaca4d(Element=flatten(merge_2), Support=flatten(support_alpaca4d), Mass=flatten(mass_point))  # -> AlpacaModel, MassOfStructure
visualisemodel = VisualiseModelAlpaca4d(AlpacaModel=assemble_model_alpaca_4d.AlpacaModel, Mass=Toggle(True))  # -> AlpacaModel, Model
modal_analyses = ModalAnalysesAlpaca4d(AlpacaModel=assemble_model_alpaca_4d.AlpacaModel, NumVibrationModes="4")  # -> AlpacaModalOutput, Frequency, Period
panel = Panel(modal_analyses.Period)

# ---- group: Post -Processing
gradientlibrary = GradientLibraryAlpaca4d(GradientIndex=Slider(12, range=0..12))  # -> reverse(ColorsList)
modal_model_view = ModalModelViewAlpaca4d(
    AlpacaModalOutput=modal_analyses.AlpacaModalOutput,
    NumberMode=Slider(1, range=0..100),
    Speed=Slider(50, range=0..10000),
    Animate=Toggle(False),
    Reset=Button(),
    Scale=Slider(5, range=0..100),
    ModelExtrude=Toggle(False),
    ColorList=gradientlibrary)
