# Grasshopper definition 4_MultiStoreyBuilding_GrounMotionAnalysis.gh (Grasshopper 1.0.7)
# plug-ins: Kangaroo Components, Alpaca4d

# ---- group: Element
data = Data(0)
data_2 = Data(0)

# ---- group: Load
# instagram:    Alpaca4d
# facebook:     Alpaca4d
# mail:         alpaca4d@gmail.com
data_3 = Data(0)
data_4 = Data(0)

# ---- group: Cross-Section
data_5 = Data(0)
data_6 = Data(0)

# ---- group: Support
data_7 = Data(0)
data_8 = Data(0)

# ---- group: Material
data_9 = Data(0)
data_10 = Data(0)

# ---- group: Constraint
data_11 = Data(0)
data_12 = Data(0)

# ---- group: Model
curve_truss = Curve([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])
curve_beam = Curve([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])
merge = Merge(Data1=curve_beam, Data2=curve_truss)
explode = Explode(Curve=merge, Recursive=True)  # -> Segments, Vertices
removeduplicatepts = RemoveDuplicatePts(Points=flatten(explode.Vertices), Tolerance=0.01)
deconstruct = Deconstruct(Point=removeduplicatepts)  # -> XComponent, YComponent, ZComponent
equality = Equality(FirstNumber=deconstruct.ZComponent, SecondNumber="0")  # -> Equality, Inequality
dispatch = Dispatch(List=removeduplicatepts, DispatchPattern=equality.Equality)  # -> ListA, ListB

# ---- group: Material
uniaxialmaterial_alpaca4d = UniaxialMaterialAlpaca4d(MatName="S235", E=210000, V=0.3, MarshallingSignalParameter=78.5, MarshallingSignalParameter_2=23.5)

# ---- group: Cross-Section
double_t_section_alpaca4d = DoubleTSectionAlpaca4d(
    MarshallingSignalParameter="IPE",
    Bsup="400",
    Binf="400",
    H="400",
    Tsup="20",
    Tinf="20",
    Tw="20",
    MarshallingSignalParameter_2=uniaxialmaterial_alpaca4d)

circular_cross_section_alpaca4d = CircularCrossSectionAlpaca4d(MarshallingSignalParameter="Circular", Diameter="300", Thickness="10", UniaxialMaterial=uniaxialmaterial_alpaca4d)

# ---- group: Support
point = Point(dispatch.ListA)
boolean_toggle = BooleanToggle(True)
support_alpaca4d = SupportAlpaca4d(
    Pos=point,
    Tx=boolean_toggle,
    Ty=boolean_toggle,
    Tz=boolean_toggle,
    Rx=boolean_toggle,
    Ry=boolean_toggle,
    Rz=boolean_toggle)

# ---- group: Load
vector_xyz = VectorXYZ(XComponent="10", YComponent=0, ZComponent="-40")  # -> Vector, Length
point_load_alpaca4d = PointLoadAlpaca4d(Force=vector_xyz.Vector, Pos=dispatch.ListB)
mass_point = MassPointAlpaca4d(NodalMass="30", Pos=dispatch.ListB)

# ---- group: Element
line_to_beam_alpaca4d = LineToBeamAlpaca4d(
    Line=curve_truss,
    MarshallingSignalParameter=ColourSwatch(SwatchColor=RGB(0, 107, 237)),
    CrossSection=circular_cross_section_alpaca4d,
    MarshallingSignalParameter_2=Toggle(False))

line_to_beam_alpaca4d_2 = LineToBeamAlpaca4d(
    Line=curve_beam,
    MarshallingSignalParameter=ColourSwatch(SwatchColor=RGB(0, 237, 40)),
    CrossSection=double_t_section_alpaca4d)

# ----
merge_2 = Merge(Data1=line_to_beam_alpaca4d_2, Data2=line_to_beam_alpaca4d)
assemble_model_alpaca_4d = AssembleModelAlpaca4d(Element=flatten(merge_2), Support=flatten(support_alpaca4d), Load=flatten(point_load_alpaca4d), Mass=flatten(mass_point))  # -> AlpacaModel, MassOfStructure
visualise_model_alpaca4d = VisualiseModelAlpaca4d(AlpacaModel=assemble_model_alpaca_4d.AlpacaModel, Model=Toggle(True), Load=Toggle(False))  # -> AlpacaModel, Model
dash = DashPattern(Curve=visualise_model_alpaca4d.Model, Pattern=Slider(0.4, range=0..1))  # -> Dashes, Gaps
preview = CustomPreview(Geometry=dash.Dashes, Material=ColourSwatch(SwatchColor=RGB(0, 0, 0)))

pi = Pi(Factor="3")
number_slider = Slider(20, range=0..100)
construct_domain = ConstructDomain(DomainStart="0", DomainEnd=pi)
range = Range(Domain=construct_domain, Steps=number_slider)
addition = Addition(A=number_slider, B=1)
value_list = ValueList({"x": 1, "y": 2, "z": 3}, selected="x")
series = Series(Start=0, Step=Slider(0.1, range=0..0.1), Count=addition)

expression = Expression(x=range, Expression="cos(x)+sin(2*x)")

quick_graph = QuickGraph(expression, SortOrder=0)
ground_motion_analysis = GroundMotionAnalysisAlpaca4d(
    AlpacaModel=visualise_model_alpaca4d.AlpacaModel,
    TmaxAnalyses="1",
    GroundMotionDirection=value_list,
    GroundMotionValues=expression,
    GroundMotionTimeStep=series,
    GroundMotionFactor="1",
    TimeStepIncrement="0.005",
    Damping="0.08")  # -> AlpacaGroundmotionOutput, MaxDisplacement, MinDisplacement
panel = Panel(ground_motion_analysis.MinDisplacement)
panel_2 = Panel(ground_motion_analysis.MaxDisplacement)

# ---- group: Post -Processing
number_slider_2 = Slider(50, range=0..10000)
gradientlibrary = GradientLibraryAlpaca4d(GradientIndex=Slider(12, range=0..12))  # -> reverse(ColorsList)
ground_motion_model_view = GroundMotionModelViewAlpaca4d(
    AlpacaGroundmotionOutput=ground_motion_analysis.AlpacaGroundmotionOutput,
    Speed=Slider(5, range=0..100),
    Animate=Toggle(False),
    Reset=Button(),
    Scale=number_slider_2,
    ModelExtrude=Toggle(False),
    ColorList=gradientlibrary)  # -> ModelDisp, PointPos, PointDisp, Trans
geometry = Geometry(ground_motion_model_view.ModelDisp)
number_slider_3 = Slider(65, range=0..100)
list_item = ListItem(List=ground_motion_model_view.PointDisp, Index=number_slider_3, Wrap=True)
list_item_2 = ListItem(List=ground_motion_model_view.PointPos, Index=number_slider_3, Wrap=True)
vector = Vector(list_item)
data_recorder = DataRecorder(list_item, DataLimit=-10, RecordData=True)
multiplication = Multiplication(A=vector, B=number_slider_2)
move = Move(Geometry=list_item_2, Motion=multiplication)  # -> Geometry, Transform
quick_graph_2 = QuickGraph(data_recorder, SortOrder=0)
vector_length = VectorLength(Vector=vector)
text_tag = TextTag(Location=list_item_2, Text=vector_length)
cloud_display = CloudDisplay(Points=move.Geometry, Colours=RGB(255, 20, 147), Size=1, SpriteType=0)
