# Grasshopper definition 5_VaultBeam_staticAnalysis.gh (Grasshopper 1.0.7)
# plug-ins: Kangaroo Components, Alpaca4d

# ---- group: Element
data = Data(0)
data_2 = Data(0)

# ---- group: Load
data_3 = Data(0)
# instagram:    Alpaca4d
# facebook:     Alpaca4d
# mail:         alpaca4d@gmail.com
# instagram:    Alpaca4d
# facebook:     Alpaca4d
# mail:         alpaca4d@gmail.com
data_4 = Data(0)

# ---- group: Cross-Section
data_5 = Data(0)
data_6 = Data(0)

# ---- group: Support
data_7 = Data(0)
data_8 = Data(0)

# ---- group: Constraint
data_9 = Data(0)
data_10 = Data(0)

# ---- group: Material
data_11 = Data(0)
data_12 = Data(0)

# ---- group: Element
data_13 = Data(0)
data_14 = Data(0)

# ---- group: Load
data_15 = Data(0)
# instagram:    Alpaca4d
# facebook:     Alpaca4d
# mail:         alpaca4d@gmail.com
data_16 = Data(0)

# ---- group: Cross-Section
data_17 = Data(0)
data_18 = Data(0)

# ---- group: Support
data_19 = Data(0)
data_20 = Data(0)

# ---- group: Constraint
data_21 = Data(0)
data_22 = Data(0)

# ---- group: Material
data_23 = Data(0)
data_24 = Data(0)

# ---- group: Element
data_25 = Data(0)
data_26 = Data(0)

# ---- group: Load
# instagram:    Alpaca4d
# facebook:     Alpaca4d
# mail:         alpaca4d@gmail.com
data_27 = Data(0)
data_28 = Data(0)

# ---- group: Cross-Section
data_29 = Data(0)
data_30 = Data(0)

# ---- group: Support
data_31 = Data(0)
data_32 = Data(0)

# ---- group: Material
data_33 = Data(0)
data_34 = Data(0)

# ---- group: Constraint
data_35 = Data(0)
data_36 = Data(0)

# ----
mesh = Mesh(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)
refine = Refine(Mesh=mesh, Level=1)
medges = MeshEdges(Mesh=refine)  # -> NakedEdges, InteriorEdges, NonManifoldEdges
demesh = DeconstructMesh(Mesh=refine)  # -> Vertices, Faces, Colours, Normals
crv = Curve([medges.InteriorEdges, medges.NakedEdges])
curve_beam = Curve(crv)
duppt = RemoveDuplicatePts(Points=flatten(demesh.Vertices), Tolerance=0.01)
pdecon = Deconstruct(Point=duppt)  # -> XComponent, YComponent, ZComponent
equals = Equality(FirstNumber=pdecon.ZComponent, SecondNumber="0")  # -> Equality, Inequality
dispatch = Dispatch(List=duppt, DispatchPattern=equals.Equality)  # -> ListA, ListB
uniaxialmaterial = UniaxialMaterialAlpaca4d(MatName="S235", E=210000, V=0.3, Rho=78.5, Fy=23.5)
pt = Point(dispatch.ListA)

circular_cross_section = CircularCrossSectionAlpaca4d(SectionName="Circular", Diameter="300", Thickness="10", UniaxialMaterial=uniaxialmaterial)

toggle = BooleanToggle(True)
toggle_2 = BooleanToggle(False)

crv_2 = Curve(curve_beam)
line_to_beam = LineToBeamAlpaca4d(Line=crv_2, CrossSection=circular_cross_section)  # -> flatten(BeamWrapper)

vec = VectorXYZ(XComponent="0", YComponent=0, ZComponent="-40")  # -> Vector, Length
point_load = PointLoadAlpaca4d(Force=vec.Vector, Pos=dispatch.ListB)
support = SupportAlpaca4d(Pos=pt, Tx=toggle, Ty=toggle, Tz=toggle, Rx=toggle_2, Ry=toggle_2, Rz=toggle)
assemble_model = AssembleModelAlpaca4d(Element=flatten(line_to_beam), Support=flatten(support), Load=flatten(point_load))  # -> AlpacaModel, MassOfStructure
static_analyses = StaticAnalysesAlpaca4d(AlpacaModel=assemble_model.AlpacaModel)
visualise_model = VisualiseModelAlpaca4d(AlpacaModel=assemble_model.AlpacaModel, Model=Toggle(True), Support=Toggle(True), Load=Toggle(False))  # -> AlpacaModel, Model
list = ValueList({"N", "V1", "V2", "M1", "M2"}, selected="N")

list_2 = ValueList({"x": 0, "y": 1, "z": 2, "xyz": 3}, selected="xyz")
gradientlibrary = GradientLibraryAlpaca4d(GradientIndex=Slider(1, range=1..12))
static_model_view = StaticModelViewAlpaca4d(AlpacaStaticOutput=static_analyses, Scale="50", ModelExtrude=Toggle(False), Direction=list_2, ColorList=gradientlibrary)  # -> ModelDisp, DisplacementRange
geo = Geometry(static_model_view.ModelDisp)

reaction_forces = ReactionForcesAlpaca4d(AlpacaStaticOutput=static_analyses, ReactionForcesView=Toggle(True), Scale="20")  # -> TagPoints, ReactionForce, ReactionMoment
node_displacement = NodeDisplacementAlpaca4d(AlpacaStaticOutput=static_analyses)  # -> Points, Trans, Rot
beam_displacement = BeamDisplacementAlpaca4d(AlpacaStaticOutput=static_analyses)  # -> TagElement, LocalTrans, LocalRot, GlobalTrans, GlobalRot
beam_force_diagram = BeamForceDiagramAlpaca4d(AlpacaStaticOutput=static_analyses, SectionForces=list)
