# Grasshopper definition 7_3ndfModel.gh (Grasshopper 1.0.7)
# plug-ins: MeshEdit Components, Alpaca4d, Kangaroo2 Components

# ---- group: Element
data = Data(0)
data_2 = Data(0)

# ---- group: Load
# instagram:    Alpaca4d
# facebook:     Alpaca4d
# mail:         alpaca4d@gmail.com
data_3 = Data(0)
data_4 = Data(0)

# ---- group: Cross-Section
data_5 = Data(0)
data_6 = Data(0)

# ---- group: Support
data_7 = Data(0)
data_8 = Data(0)

# ---- group: Material
data_9 = Data(0)
data_10 = Data(0)

# ---- group: Constraint
data_11 = Data(0)
data_12 = Data(0)

# ---- group: Model
number_slider = Slider(43, range=0..100)
number_slider_2 = Slider(41, range=0..100)
number_slider_3 = Slider(10, range=0..10)
number_slider_4 = Slider(4, range=0..10)

rectangle = Rectangle(Plane=PlaneXY(0, 0, 0), XSize=number_slider_2, YSize=number_slider, Radius=0)  # -> Rectangle, Length
series = Series(Start=0, Step=number_slider_4, Count=number_slider_3)
mesh_uv = MeshSurface(Surface=rectangle.Rectangle, UCount="10", VCount="10", Overhang=True, Equalize=False)
Z = UnitZ(Factor=series)
move = Move(Geometry=mesh_uv, Motion=Z)  # -> Geometry, Transform

demesh = DeconstructMesh(Mesh=move.Geometry)  # -> flatten(Vertices), Faces, Colours, Normals
cullpt = CullDuplicates(Points=flatten(demesh.Vertices), Tolerance=0.1, CullMode=3)  # -> Points, Indices, Valence
pdecon = Deconstruct(Point=cullpt.Points)  # -> XComponent, YComponent, ZComponent
smaller = SmallerThan(FirstNumber=pdecon.ZComponent, SecondNumber="0.1")  # -> SmallerThan, OrEqualTo
cull = CullPattern(List=cullpt.Points, CullPattern=smaller.OrEqualTo)

# ---- group: Material
division = Division(A="150", B=2)
ndmaterial = NDMaterialAlpaca4d(MatName="Land", E="150", G=division, V=0.3, Rho=78.5, Fy=23.5)

uniaxialmaterial = UniaxialMaterialAlpaca4d(MatName="S235", E=210000, V=0.3, Rho=78.5, Fy=23.5)

# ---- group: Cross-Section
circular_cross_section = CircularCrossSectionAlpaca4d(SectionName="C", Diameter="300", Thickness="10", UniaxialMaterial=uniaxialmaterial)

# ---- group: Element
mesh_series_to_brick = MeshSeriesToBrickAlpaca4d(MeshSeries=move.Geometry)  # -> flatten(Brick)
brick_element = BrickElementAlpaca4d(Brick=mesh_series_to_brick, Colour=ColourSwatch(SwatchColor=RGB(219, 33, 207)), NDMaterial=ndmaterial)  # -> simplify(SolidWrapper)

# ---- group: Support
toggle = BooleanToggle(True)
support = SupportAlpaca4d(Pos=cull, Tx=toggle, Ty=toggle, Tz=toggle, Rx=toggle, Ry=toggle, Rz=toggle)

# ---- group: Model
item = ListItem(List=move.Geometry, Index=0, Wrap=True)  # -> Item1, Item
explode = MeshExplode(Mesh=item.Item1, Interpolate=False)
number_slider_5 = Slider(6, range=0..100)
area = MeshArea(Mesh=item.Item1)  # -> Area, Centroid
area_2 = MeshArea(Mesh=explode)  # -> Area, Centroid
cir = Circle(Plane=area.Centroid, Radius=number_slider_5)
dist = Distance(PointA=area_2.Centroid, PointB=area.Centroid)
smaller_2 = SmallerThan(FirstNumber=dist, SecondNumber=number_slider_5)  # -> SmallerThan, OrEqualTo
cull_2 = CullPattern(List=explode, CullPattern=smaller_2.OrEqualTo)
interpiano = Slider(4, range=0..10)
n = Slider(10, range=0..10)
mjoin = MeshJoin(Meshes=cull_2)
series_2 = Series(Start=0, Step=interpiano, Count=n)
Z_2 = UnitZ(Factor=series_2)
move_2 = Move(Geometry=mjoin, Motion=graft(Z_2))  # -> flatten(Geometry), Transform
medges = MeshEdges(Mesh=mjoin)  # -> NakedEdges, InteriorEdges, NonManifoldEdges
cull_i = CullIndex(List=move_2.Geometry, Indices="0", Wrap=True)
move_3 = Move(Geometry=[medges.NakedEdges, medges.InteriorEdges], Motion=graft(Z_2))  # -> Geometry, Transform
explode_2 = MeshExplode(Mesh=cull_i, Interpolate=False)
flip = FlipMatrix(Data=move_3.Geometry)
demesh_2 = DeconstructMesh(Mesh=explode_2)  # -> Vertices, Faces, Colours, Normals
subtraction = Subtraction(A=n, B=1)
loft = Loft(Curves=flip, Options={Adjust=False, Closed=False, LoftEnds=0, LoftSimp=0, LoftType=0, Rebuild=10, Refit=0.01})
item_2 = ListItem(List=demesh_2.Vertices, Index=0, Wrap=True)  # -> Item, Item1, Item2, Item3
mesh_uv_2 = MeshSurface(Surface=loft, UCount=subtraction, VCount="1", Overhang=True, Equalize=False)
triangulate = MeshTriangulate(Mesh=mesh_uv_2, ShortDiagonal=True)
ln = Line(StartPoint=item_2.Item1, EndPoint=item_2.Item3)  # -> simplify(Line)
ln_2 = Line(StartPoint=item_2.Item, EndPoint=item_2.Item2)  # -> simplify(Line)
medges_2 = MeshEdges(Mesh=triangulate)  # -> NakedEdges, InteriorEdges, NonManifoldEdges
entwine = Entwine(
    Branch00=ln_2,
    Branch01=ln,
    Branch02=medges_2.NakedEdges,
    Branch03=medges_2.InteriorEdges,
    Branch04=medges_2.NonManifoldEdges,
    FlattenInputs=True)  # -> flatten(Result)

# ----
dupln = RemoveDuplicateLines(Lines=entwine, Tolerance=0.01)

# ---- group: Model (continued)
midpt = CurveMiddle(Curve=dupln)
pdecon_2 = Deconstruct(Point=midpt)  # -> XComponent, YComponent, ZComponent
bnd = Bounds(Numbers=pdecon_2.ZComponent)
dedomain = DeconstructDomain(Domain=bnd)  # -> Start, End
larger = LargerThan(FirstNumber=pdecon_2.ZComponent, SecondNumber=dedomain.Start)  # -> LargerThan, OrEqualTo
cull_3 = CullPattern(List=dupln, CullPattern=larger.LargerThan)
end = EndPoints(Curve=cull_3)  # -> Start, End
cullpt_2 = CullDuplicates(Points=end.End, Tolerance=0.1, CullMode=3)  # -> Points, Indices, Valence

# ---- group: Load
vec = VectorXYZ(XComponent="-10", YComponent=0, ZComponent="-10000")  # -> Vector, Length
point_load = PointLoadAlpaca4d(Force=vec.Vector, Pos=cullpt_2.Points)

# ---- group: Element
line_to_beam = LineToBeamAlpaca4d(Line=cull_3, CrossSection=circular_cross_section, BeamType=Toggle(False))

# ----
assemble_model = AssembleModelAlpaca4d(Element=flatten([brick_element, line_to_beam]), Support=flatten(support), Load=flatten(point_load))  # -> AlpacaModel, MassOfStructure
visualise_model = VisualiseModelAlpaca4d(AlpacaModel=assemble_model.AlpacaModel, Load=Toggle(True))  # -> AlpacaModel, Model
geo = Geometry(visualise_model.Model)
ndfanalyses = NDFAnalysesAlpaca4d(MarshallingSignalParameter=visualise_model.AlpacaModel)

# ---- group: Post -Processing
gradientlibrary = GradientLibraryAlpaca4d(GradientIndex=Slider(11, range=0..12))  # -> reverse(ColorsList)
static_model_view = StaticModelViewAlpaca4d(AlpacaStaticOutput=ndfanalyses, Scale=Slider(5, range=0..100), ModelExtrude=Toggle(False), ColorList=gradientlibrary)  # -> ModelDisp, DisplacementRange
geo_2 = Geometry(static_model_view.ModelDisp)
item_3 = ListItem(List=static_model_view.DisplacementRange, Index=0, Wrap=True)  # -> Item, Item1
