# Grasshopper definition 8_3ndfModel2.gh (Grasshopper 1.0.7)
# plug-ins: MeshEdit Components, Alpaca4d

# ---- group: Element
data = Data(0)
data_2 = Data(0)

# ---- group: Load
# instagram:    Alpaca4d
# facebook:     Alpaca4d
# mail:         alpaca4d@gmail.com
data_3 = Data(0)
data_4 = Data(0)

# ---- group: Cross-Section
data_5 = Data(0)
data_6 = Data(0)

# ---- group: Support
data_7 = Data(0)
data_8 = Data(0)

# ---- group: Material
data_9 = Data(0)
data_10 = Data(0)

# ---- group: Constraint
data_11 = Data(0)
data_12 = Data(0)

# ---- group: variable
ncolumn = Slider(4, range=0..10)
number_slider = Slider(71, range=0..100)

# ----
number_slider_2 = Slider(1, range=0..10)
number_slider_3 = Slider(20, range=0..20)
mplane = MeshPlane(Boundary={Plane=PlaneXY(0, 0, 0), Size=Domain2(u=-10..10, v=-10..10)}, WidthCount=10, HeightCount=10)  # -> Mesh, Area
multiplication = Multiplication(A=number_slider_2, B=number_slider_3)
explode = MeshExplode(Mesh=mplane.Mesh, Interpolate=False)
lng = ListLength(List=explode)
subtraction = Subtraction(A=multiplication, B=number_slider_2)
Z = UnitZ(Factor=subtraction)
subtraction_2 = Subtraction(A=lng, B=ncolumn)
Z_2 = UnitZ(Factor=number_slider_2)
series = Series(Start=0, Step=number_slider_2, Count=number_slider_3)
move = Move(Geometry=graft(mplane.Mesh), Motion=Z)  # -> Geometry, Transform
Z_3 = UnitZ(Factor=series)
move_2 = Move(Geometry=graft(move.Geometry), Motion=Z_2)  # -> Geometry, Transform
reduce = RandomReduce(List=explode, Reduction=subtraction_2, Seed=number_slider)
entwine = Entwine(Branch00=move.Geometry, Branch01=move_2.Geometry, FlattenInputs=True)  # -> flatten(Result)
move_3 = Move(Geometry=graft(reduce), Motion=Z_3)  # -> Geometry, Transform
mesh_series_to_brick = MeshSeriesToBrickAlpaca4d(MeshSeries=move_3.Geometry)  # -> flatten(Brick)
mesh_series_to_brick_2 = MeshSeriesToBrickAlpaca4d(MeshSeries=entwine)  # -> flatten(Brick)
entwine_2 = Entwine(Branch00=mesh_series_to_brick, Branch01=mesh_series_to_brick_2, FlattenInputs=True)
demesh = DeconstructMesh(Mesh=entwine_2)  # -> flatten(Vertices), Faces, Colours, Normals
cullpt = CullDuplicates(Points=flatten(demesh.Vertices), Tolerance=0.1, CullMode=3)  # -> Points, Indices, Valence
pdecon = Deconstruct(Point=cullpt.Points)  # -> XComponent, YComponent, ZComponent
bnd = Bounds(Numbers=pdecon.YComponent)
bnd_2 = Bounds(Numbers=pdecon.ZComponent)
pdecon_2 = Deconstruct(Point=cullpt.Points)  # -> XComponent, YComponent, ZComponent
dedomain = DeconstructDomain(Domain=bnd)  # -> Start, End
dedomain_2 = DeconstructDomain(Domain=bnd_2)  # -> Start, End
smaller = SmallerThan(FirstNumber=pdecon_2.ZComponent, SecondNumber=dedomain_2.Start)  # -> SmallerThan, OrEqualTo
larger = LargerThan(FirstNumber=pdecon.ZComponent, SecondNumber=dedomain_2.End)  # -> LargerThan, OrEqualTo
cull = CullPattern(List=cullpt.Points, CullPattern=smaller.OrEqualTo)
cull_2 = CullPattern(List=cullpt.Points, CullPattern=larger.OrEqualTo)

# ---- group: Material
division = Division(A="39000", B=2)
ndmaterial = NDMaterialAlpaca4d(MatName="S235", E="39000", G=division, V=0.3, Rho=78.5, Fy=23.5)

# ---- group: Element
brick_element = BrickElementAlpaca4d(Brick=entwine_2, Colour=ColourSwatch(SwatchColor=RGB(219, 33, 207)), NDMaterial=ndmaterial)  # -> simplify(SolidWrapper)

# ---- group: Load
vec = VectorXYZ(XComponent="-100", YComponent=0, ZComponent="-1000")  # -> Vector, Length
point_load = PointLoadAlpaca4d(Force=vec.Vector, Pos=cull_2)

# ---- group: Support
toggle = BooleanToggle(True)
support = SupportAlpaca4d(Pos=cull, Tx=toggle, Ty=toggle, Tz=toggle, Rx=toggle, Ry=toggle, Rz=toggle)

# ----
assemble_model = AssembleModelAlpaca4d(Element=flatten(brick_element), Support=flatten(support), Load=flatten(point_load))  # -> AlpacaModel, MassOfStructure
visualise_model = VisualiseModelAlpaca4d(AlpacaModel=assemble_model.AlpacaModel, Load=Toggle(True))  # -> AlpacaModel, Model
geo = Geometry(visualise_model.Model)
ndfanalyses = NDFAnalysesAlpaca4d(MarshallingSignalParameter=visualise_model.AlpacaModel)

# ---- group: Post -Processing
gradientlibrary = GradientLibraryAlpaca4d(GradientIndex=Slider(11, range=0..12))  # -> reverse(ColorsList)
static_model_view = StaticModelViewAlpaca4d(AlpacaStaticOutput=ndfanalyses, Scale=Slider(28, range=0..100), ModelExtrude=Toggle(False), ColorList=gradientlibrary)  # -> ModelDisp, DisplacementRange
item = ListItem(List=static_model_view.DisplacementRange, Index=0, Wrap=True)  # -> Item, Item1
X = UnitX(Factor=Slider(39, range=0..100))
move_4 = Move(Geometry=static_model_view.ModelDisp, Motion=X)  # -> Geometry, Transform

# ----
galapagos = Galapagos(fitness=item, gene=number_slider)
