# Grasshopper definition ExampleScriptsForCompiling.gh (Grasshopper 1.0.7)

# ----
# Working Version
# Return ------------
number_slider = Slider(0, range=0..1)
# Ingegneria Parametrica
# Multi Supported Beam
# Author: Marco Pellegrino
# Contact: ingegneria.parametrica.ltd@gmail.com
number_slider_2 = Slider(21.91, range=1..30)
simple_beam = GhPythonScript(length=number_slider_2, q=Slider(6, range=0..10), E="2100000", Iyy="0.0000021", boundaryCondition=number_slider)  # -> readMe, deflection, maxBendingMoment, maxShearForce, Geometry; inputs boundaryCondition: Int32
# ---------- simple_beam: Python ----------
"""Useful script for simple supported beam analyses
    Inputs:
        length: The length of the beam
        q: Uniform Distributed Load
        E: Young's Modulus
        Iyy: Moment of inertia
        boundaryCondition: 0 - simple supported beam 1 - encastred Beam
    Output:
       deflection: max deflection along the beam
       maxBendingMoment: max bending moment along the beam
       maxShearForce: max shear force along the beam
       """


from ghpythonlib.componentbase import executingcomponent as component
import Grasshopper, GhPython
import System
import Rhino
import Rhino.Geometry as rg
import rhinoscriptsyntax as rs



class MyComponent(component):
    
    def RunScript(self, length, q, E, Iyy, boundaryCondition):
        import Grasshopper as gh
        
        ReadMe = []
        Geometries = []
        
        def CalcDeflection(q,length,E,Iyy,boundaryCondition):
            if boundaryCondition == 0:
                deflection = 5.0/384.0 * (q * length**4) / ( E * Iyy)
                ReadMe.append('deflection: 5/384 * (q * length^4) / ( E * Iyy)')
            elif boundaryCondition == 1:
                deflection = 1.0/384.0 * (q * length**4) / ( E * Iyy)
                ReadMe.append('deflection: 1/384 * (q * length^4) / ( E * Iyy)')
            return deflection


        def MaxBendingMoment(q,length,boundaryCondition):
            if boundaryCondition == 0:
                max_BendingMoment = q * length**2 / 8.0
                ReadMe.append('max Bending Moment: q * length^2 / 8')
            if boundaryCondition == 1:
                max_BendingMoment = q * length**2 / 12
                ReadMe.append('max Bending Moment: q * length^2 / 12')
            return max_BendingMoment


        def MaxShearForce(q,length,boundaryCondition):
            if boundaryCondition == 0:
                MaxShearForce = q * length / 2.0
                ReadMe.append('max Shear Force: q * length / 2')
            if boundaryCondition == 1:
                MaxShearForce = q * length / 2.0
                ReadMe.append('max Shear Force: q * length / 2')
            return MaxShearForce
        
        
        def VisualOutput(length):
            beam = rg.Line(0,0,0,length,0,0).ToNurbsCurve()
            Geometries.append(beam)
            
            # Create boundary
            startPoint = beam.PointAtStart
            endPoint = beam.PointAtEnd
            circleStart = rg.Circle(rg.Plane(startPoint,rg.Vector3d(0,1,0)), beam.GetLength()*0.05)
            circleEnd = rg.Circle(rg.Plane(endPoint,rg.Vector3d(0,1,0)), beam.GetLength()*0.05)
            Geometries.append(circleStart)
            Geometries.append(circleEnd)
            return Geometries
        
        checkData = True
        if length is None:
            msg = "Input parameter 'length' failed to collect data"
            self.AddRuntimeMessage(gh.Kernel.GH_RuntimeMessageLevel.Warning,msg)
            checkData = False
        
        if q is None:
            msg = "Input parameter 'q' failed to collect data"
            self.AddRuntimeMessage(gh.Kernel.GH_RuntimeMessageLevel.Warning,msg)
            checkData = Falsemax_ShearForce
        
        if E is None:
            msg = "Input parameter 'E' failed to collect data"
            self.AddRuntimeMessage(gh.Kernel.GH_RuntimeMessageLevel.Warning,msg)
            checkData = False
        
        if Iyy is None:
            msg = "Input parameter 'Iyy' failed to collect data"
            self.AddRuntimeMessage(gh.Kernel.GH_RuntimeMessageLevel.Warning,msg)
            checkData = False
        
        if boundaryCondition is None:
            boundaryCondition = 0
        
        if checkData:
            deflection = CalcDeflection(q,length,E,Iyy,boundaryCondition)
            max_BendingMoment = MaxBendingMoment(q,length,boundaryCondition)
            max_ShearForce = MaxShearForce(q,length,boundaryCondition)
            Geometry = VisualOutput(length)
            return ReadMe, deflection, max_BendingMoment, max_ShearForce, Geometry
# ---------- end simple_beam ----------
panel = Panel(simple_beam.maxBendingMoment)
panel_2 = Panel(simple_beam.readMe)
panel_3 = Panel(simple_beam.deflection)
panel_4 = Panel(simple_beam.maxShearForce)
