# Grasshopper definition 3dPrintTest.gh (Grasshopper 1.0.7)
# plug-ins: MeshEdit Components, treesloth01, Pufferfish, NGon 2, Human, Alpaca4d, VoxelPrint, ggRhinoIFC, karambaGH

# Format Engineers CAD Information Issue Disclaimer
# 
# Project: PROJECT NAME
# 
# You should use this model for reference purposes only to assist in co-ordinating your work and is supplementary to formally issued drawings. Once the data is introduced into your own CAD or other system Format Engineers Ltd. can take no responsibility for its accuracy.
# 
# The last set of formally issued paper drawings are the contractual documents which represent the current stage of design development. If you have any queries, please contact the project CAD co-ordinator or the CAD Development Team.
# 
# Changes:
# 
# YYYY-MM-DD: Summary of changes
# 
# Usage notes:
# 
# This definition includes a basic implementation of Merbarki's Farthest Point Seeding algorithm (2005), adapted for tracing lines of principal curvature on NURBS surfaces. Requires modified Triangle.NET, if this isn't attached then... good luck! There are currently two main limitations: (a) this implementation measures density in parameter space, and (b) it doesn't include the dynamic refinement of density that Mebarki suggests.
gggrasshoppersettings = GgGrasshopperSettings(
    SettingsData_IFCSettings_Format="STEP",
    SettingsData_IFCSettings_GenerateOwnerHistory=True,
    SettingsData_IFCSettings_IdentifyObsolete=True,
    SettingsData_IFCSettings_LastUsedUnits="Meters",
    SettingsData_IFCSettings_Radians=True,
    SettingsData_IFCSettings_RepMapExport="NONE",
    SettingsData_IFCSettings_Target="Universal",
    SettingsData_IFCSettings_VersionIFC="IFC2x3",
    SettingsData_RevitSettings_Format="STEP",
    SettingsData_RevitSettings_GenerateOwnerHistory=True,
    SettingsData_RevitSettings_IdentifyObsolete=True,
    SettingsData_RevitSettings_LastUsedUnits="Meters",
    SettingsData_RevitSettings_Radians=True,
    SettingsData_RevitSettings_RepMapExport="NONE",
    SettingsData_RevitSettings_Target="Universal",
    SettingsData_RevitSettings_VersionIFC="IFC4")
brep = Brep(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)
voxelizer = BrepToVoxel(Brep=brep, VoxelSize="10", BeadWidth="30", LayerHeight="10")  # -> PointList, VoxelSettings
panel = Panel("10")
panel_2 = Panel("0.1")
rdpoints = RemoveDuplicatePointsKaramba3D(Point=flatten(voxelizer.PointList), LimitDistance=0.005)  # -> graft(OutPoint), Info, Indexes
division = Division(A="1", B="10")
rdpoints_2 = RemoveDuplicatePointsKaramba3D(Point=voxelizer.PointList, LimitDistance=0.005)  # -> OutPoint, Info, Indexes
concat = Concatenate(FragmentA="{<", FragmentB=Slider(20, range=1..60), FragmentC="}")
split = SplitTree(Data=simplify(rdpoints_2.OutPoint), Masks=flatten(concat))  # -> Positive, Negative
pt = Point(split.Positive)
voxels = Voxels(Points=graft(rdpoints_2.OutPoint), Scale=division)
weldvertices = MeshWeldVertices(Mesh=voxels, Tolerance=0.01)  # -> RuntimeMessage, Mesh
data = Data(simplify(weldvertices.Mesh))
shift = ShiftPaths(Data=data, Offset=-1)  # -> flatten(Data)
partition = PartitionList(List=shift, Size="24")  # -> simplify(Chunks)
concat_2 = Concatenate(FragmentA="{<", FragmentB=Slider(0, range=0..487), FragmentC="}")
picture_name = Panel("test")
split_2 = SplitTree(Data=simplify(partition), Masks=flatten(concat_2))  # -> Positive, Negative
tstat = TreeStatistics(Tree=split_2.Positive)  # -> Paths, Length, Count
concat_3 = Concatenate(FragmentA=picture_name, FragmentB=tstat.Count)
demesh = DeconstructMesh(Mesh=flatten(split_2.Positive))  # -> Vertices, Faces, Colours, Normals
rdpoints_3 = RemoveDuplicatePointsKaramba3D(Point=flatten(demesh.Vertices), LimitDistance=0.005)  # -> graft(OutPoint), Info, Indexes
pdecon = Deconstruct(Point=flatten(rdpoints_3.OutPoint))  # -> XComponent, YComponent, ZComponent

pt_2 = Point(flatten(rdpoints_3.OutPoint))
pdecon_2 = Deconstruct(Point=pt_2)  # -> XComponent, YComponent, ZComponent
bnd = Bounds(Numbers=pdecon_2.ZComponent)
dedomain = DeconstructDomain(Domain=bnd)  # -> Start, End
addition = Addition(A="0.01", B=dedomain.Start)
smaller = SmallerThan(FirstNumber=pdecon_2.ZComponent, SecondNumber=addition)  # -> SmallerThan, OrEqualTo

ndmaterial = NDMaterialAlpaca4d(MatName="S235", E=210000, V=0.3, Rho=78.5, Fy=23.5)
weldvertices_2 = MeshWeldVertices(Mesh=split_2.Positive, Tolerance=0.01)  # -> RuntimeMessage, Mesh
smaller_2 = SmallerThan(FirstNumber=pdecon.ZComponent, SecondNumber="10")  # -> SmallerThan, OrEqualTo
cull = CullPattern(List=flatten(rdpoints_3.OutPoint), CullPattern=smaller_2.OrEqualTo)
brick_element = BrickElementAlpaca4d(Brick=flatten(weldvertices_2.Mesh), Colour=ColourSwatch(SwatchColor=RGB(255, 255, 255)), NDMaterial=ndmaterial)  # -> flatten(SolidWrapper)
Z = UnitZ(Factor="-10")
toggle = BooleanToggle(True)
dispatch = Dispatch(List=pt_2, DispatchPattern=smaller.SmallerThan)  # -> ListA, ListB
pt_3 = Point(dispatch.ListA)
pt_4 = Point(dispatch.ListB)
support = SupportAlpaca4d(Pos=pt_3, Tx=toggle, Ty=toggle, Tz=toggle, Rx=toggle, Ry=toggle, Rz=toggle)
point_load = PointLoadAlpaca4d(Force=Z, Pos=pt_4)
assemble_model = AssembleModelAlpaca4d(Element=flatten(brick_element), Support=flatten(support), Load=flatten(point_load))  # -> AlpacaModel, MassOfStructure
brick_stress = BrickStressAlpaca4d()  # -> Brick, StressValue, StressRange; disabled
ndfanalyses = NDFAnalysesAlpaca4d(MarshallingSignalParameter=assemble_model.AlpacaModel)
gradientlibrary = GradientLibraryAlpaca4d(GradientIndex=11)  # -> reverse(ColorsList)
multiplication = Multiplication(A=Slider(207, range=1..1000), B="100")
number_slider = Slider(0, range=0..5)  # disabled
node_displacement = NodeDisplacementAlpaca4d(AlpacaStaticOutput=ndfanalyses)  # -> Points, Trans, Rot; disabled
brick_stress_2 = BrickStressAlpaca4d(AlpacaStaticOutput=ndfanalyses, StressView=number_slider)  # -> Brick, StressValue, StressRange; disabled

# ----
# if you modify the screen
update = Button()

save_picture = BooleanToggle(True)
select_palette = Slider(0, range=0..6)
mjoin = MeshJoin(Meshes=brick_stress_2.Brick)  # disabled
panel_3 = Panel("""2
4
6
4
3
3
6""")
swatch = ColourSwatch(SwatchColor=RGB(255, 255, 255))  # disabled
swatch_2 = ColourSwatch(SwatchColor=RGB(0, 0, 0))  # disabled
item = ListItem(List=panel_3, Index=select_palette, Wrap=True)
swatch_3 = ColourSwatch(SwatchColor=RGB(148, 0, 181))  # disabled
swatch_4 = ColourSwatch(SwatchColor=RGB(255, 170, 0))  # disabled
swatch_5 = ColourSwatch(SwatchColor=RGB(34, 58, 212))  # disabled
swatch_6 = ColourSwatch(SwatchColor=RGB(48, 159, 255))  # disabled
swatch_7 = ColourSwatch(SwatchColor=RGB(0, 0, 0))  # disabled
swatch_8 = ColourSwatch(SwatchColor=RGB(194, 194, 14))  # disabled
swatch_9 = ColourSwatch(SwatchColor=RGB(237, 12, 42))  # disabled
merge = Merge(Data1=swatch, Data2=swatch_2, Data3=swatch, Data4=swatch_2, Data5=swatch, Data6=swatch, Data7=swatch)  # disabled
merge_2 = Merge(Data1=swatch_7, Data2=swatch_3, Data3=swatch_4, Data4=swatch_8, Data5=swatch_5, Data6=swatch_6, Data7=swatch_9)  # disabled
gradientlibrary_2 = GradientLibrary(gradIndex=item)  # -> colors; inputs gradIndex: Int32
#   port colors: A series of colors to be plugged into the "Ladybug_Legend Parameters" component.
# ---------- gradientlibrary_2: Python ----------
"""
Preset of gradient colors perfect for Data Visualisation
    Inputs:
        gradIndex: An index refering to one of the following possible gradients:
            0 - Orignal Ladybug
            1 - Nuanced Ladybug
            2 - Multi-colored Ladybug
            3 - Ecotect
            4 - Thermal Comfort Percentage
            5 - Thermal Comfort Colors
            6 - Shade Benefit/Harm
            7 - Shade Harm
            8 - Shade Benefit
            9 - CFD Colors 1
            10 - Radiation Benefit
            11 - Gsa10 Colour
            12 - Gsa9 Colour
    Returns:
        customColors: A series of colors.
"""

ghenv.Component.Name = "Gradient Library"
ghenv.Component.NickName = 'GradientLibrary'
#ghenv.Component.Message = 'GradientLibrary\nWIP'

import scriptcontext as sc
import Grasshopper.Kernel as gh
import System

gradientLibrary = {
        0: [System.Drawing.Color.FromArgb(75, 107, 169), System.Drawing.Color.FromArgb(115, 147, 202), System.Drawing.Color.FromArgb(170, 200, 247), System.Drawing.Color.FromArgb(193, 213, 208), System.Drawing.Color.FromArgb(245, 239, 103), System.Drawing.Color.FromArgb(252, 230, 74), System.Drawing.Color.FromArgb(239, 156, 21), System.Drawing.Color.FromArgb(234, 123, 0), System.Drawing.Color.FromArgb(234, 74, 0), System.Drawing.Color.FromArgb(234, 38, 0)],
        1: [System.Drawing.Color.FromArgb(49,54,149), System.Drawing.Color.FromArgb(69,117,180), System.Drawing.Color.FromArgb(116,173,209), System.Drawing.Color.FromArgb(171,217,233), System.Drawing.Color.FromArgb(224,243,248), System.Drawing.Color.FromArgb(255,255,191), System.Drawing.Color.FromArgb(254,224,144), System.Drawing.Color.FromArgb(253,174,97), System.Drawing.Color.FromArgb(244,109,67), System.Drawing.Color.FromArgb(215,48,39), System.Drawing.Color.FromArgb(165,0,38)],
        2: [System.Drawing.Color.FromArgb(4,25,145), System.Drawing.Color.FromArgb(7,48,224), System.Drawing.Color.FromArgb(7,88,255), System.Drawing.Color.FromArgb(1,232,255), System.Drawing.Color.FromArgb(97,246,156), System.Drawing.Color.FromArgb(166,249,86), System.Drawing.Color.FromArgb(254,244,1), System.Drawing.Color.FromArgb(255,121,0), System.Drawing.Color.FromArgb(239,39,0), System.Drawing.Color.FromArgb(138,17,0)],
        3: [System.Drawing.Color.FromArgb(0,0,255), System.Drawing.Color.FromArgb(53,0,202), System.Drawing.Color.FromArgb(107,0,148), System.Drawing.Color.FromArgb(160,0,95), System.Drawing.Color.FromArgb(214,0,41), System.Drawing.Color.FromArgb(255,12,0), System.Drawing.Color.FromArgb(255,66,0), System.Drawing.Color.FromArgb(255,119,0), System.Drawing.Color.FromArgb(255,173,0), System.Drawing.Color.FromArgb(255,226,0), System.Drawing.Color.FromArgb(255,255,0)],
        4: [System.Drawing.Color.FromArgb(0,0,0), System.Drawing.Color.FromArgb(110,0,153), System.Drawing.Color.FromArgb(255,0,0), System.Drawing.Color.FromArgb(255,255,102), System.Drawing.Color.FromArgb(255,255,255)],
        5: [System.Drawing.Color.FromArgb(0,136,255), System.Drawing.Color.FromArgb(200,225,255), System.Drawing.Color.FromArgb(255,255,255), System.Drawing.Color.FromArgb(255,230,230), System.Drawing.Color.FromArgb(255,0,0)],
        6: [System.Drawing.Color.FromArgb(5,48,97), System.Drawing.Color.FromArgb(33,102,172), System.Drawing.Color.FromArgb(67,147,195), System.Drawing.Color.FromArgb(146,197,222), System.Drawing.Color.FromArgb(209,229,240), System.Drawing.Color.FromArgb(255,255,255), System.Drawing.Color.FromArgb(253,219,199), System.Drawing.Color.FromArgb(244,165,130), System.Drawing.Color.FromArgb(214,96,77), System.Drawing.Color.FromArgb(178,24,43), System.Drawing.Color.FromArgb(103,0,31)],
        7: [System.Drawing.Color.FromArgb(255,255,255), System.Drawing.Color.FromArgb(253,219,199), System.Drawing.Color.FromArgb(244,165,130), System.Drawing.Color.FromArgb(214,96,77), System.Drawing.Color.FromArgb(178,24,43), System.Drawing.Color.FromArgb(103,0,31)],
        8: [System.Drawing.Color.FromArgb(255,255,255), System.Drawing.Color.FromArgb(209,229,240), System.Drawing.Color.FromArgb(146,197,222), System.Drawing.Color.FromArgb(67,147,195), System.Drawing.Color.FromArgb(33,102,172), System.Drawing.Color.FromArgb(5,48,97)],
        9: [System.Drawing.Color.FromArgb(0,16,120), System.Drawing.Color.FromArgb(38,70,160), System.Drawing.Color.FromArgb(5,180,222), System.Drawing.Color.FromArgb(16,180,109), System.Drawing.Color.FromArgb(59,183,35), System.Drawing.Color.FromArgb(143,209,19), System.Drawing.Color.FromArgb(228,215,29), System.Drawing.Color.FromArgb(246,147,17), System.Drawing.Color.FromArgb(243,74,0), System.Drawing.Color.FromArgb(255,0,0)],
        10: [System.Drawing.Color.FromArgb(0,191,48), System.Drawing.Color.FromArgb(255,238,184), System.Drawing.Color.FromArgb(255,0,0)],
        11: [System.Drawing.Color.FromArgb(204,0,71), System.Drawing.Color.FromArgb(255,182,71), System.Drawing.Color.FromArgb(206,255,115), System.Drawing.Color.FromArgb(26,180, 214),System.Drawing.Color.FromArgb(0,0,207)],
        12: [System.Drawing.Color.FromArgb(255, 51, 51), System.Drawing.Color.FromArgb(255, 170, 51), System.Drawing.Color.FromArgb(255, 255, 51), System.Drawing.Color.FromArgb(170, 255, 125), System.Drawing.Color.FromArgb(51, 255, 231), System.Drawing.Color.FromArgb(51, 170, 255), System.Drawing.Color.FromArgb(51,51, 255)]}
colors = gradientLibrary[gradIndex]
# ---------- end gradientlibrary_2 ----------
static_model_view = StaticModelViewAlpaca4d(AlpacaStaticOutput=ndfanalyses, Scale=multiplication, ColorList=gradientlibrary_2)  # -> ModelDisp, DisplacementRange
mjoin_2 = MeshJoin(Meshes=static_model_view.ModelDisp)
mesh = Mesh(mjoin_2)
item_2 = ListItem(List=merge_2, Index=select_palette, Wrap=True)  # disabled
col = Colour(gradientlibrary_2)  # disabled

# ----
# CHOOSE
# YOUR COLOUR
panel_4 = Panel("9")  # disabled
range = Range(Domain=Domain(0, 1), Steps=panel_4)  # disabled
twnthrucols = TweenThroughColors(Colors=col, Factor=range, Normalized=True, Equalized=False, Weighted=False, Degree=3, InterpolationType=0, Alpha=True)  # disabled

item_3 = ListItem(List=merge, Index=select_palette, Wrap=True)  # disabled
python = GhPythonScript(color=item_2)  # -> out; inputs color: Color; disabled
# ---------- python: Python ----------
import Rhino.ApplicationSettings.AppearanceSettings
import System
import scriptcontext

settings = Rhino.ApplicationSettings.AppearanceSettings
settings.ViewportBackgroundColor = color

scriptcontext.doc.Views.Redraw()
# ---------- end python ----------
viewports = ViewportProperties(Update=update, AutoUpdate=False)  # -> ViewportNames, ActiveViewportIndex, ViewportBounds, ViewportDisplayMode, CameraLocation, CameraTarget, CameraPlane, CameraLensLength, CameraProjection, CameraUp; disabled
item_4 = ListItem(List=viewports.ViewportBounds, Index=viewports.ActiveViewportIndex, Wrap=True)  # disabled
drec = DeconstuctRectangle(Rectangle=item_4)  # -> BasePlane, XInterval, YInterval; disabled
number_slider_2 = Slider(35, range=1..70)  # disabled
int = Integer(expr("x/2", drec.XInterval))  # disabled
int_2 = Integer(expr("x*0.85", drec.YInterval))  # disabled
panel_5 = Panel("2")  # disabled
panel_6 = Panel("0 to 20")  # disabled
number_slider_3 = Slider(16, range=1..50)  # disabled
panel_7 = Panel("200")  # disabled
random = Random(Range=panel_6, Number=panel_7, Seed=2)  # disabled
multiplication_2 = Multiplication(A=number_slider_3, B=0.5)  # disabled
num = Number(expr("Round(x,0)", random))  # disabled
bnd_2 = Bounds(Numbers=num)  # disabled
panel_8 = Panel(" ")  # disabled
dedomain_2 = DeconstructDomain(Domain=bnd_2)  # -> Start, End; disabled
panel_9 = Panel("90 s")  # disabled
panel_10 = Panel("9861")  # disabled
merge_3 = Merge(Data1=dedomain_2.Start, Data2=dedomain_2.End)  # disabled
num_2 = Number(panel_10)  # disabled
num_3 = Number(panel_9)  # disabled
panel_11 = Panel("Iosevka")  # disabled
int_3 = Integer(drec.YInterval)  # disabled
int_4 = Integer(drec.XInterval)  # disabled
captureview = Ladybug_CaptureView(fileName=concat_3, imageWidth=int_4, imageHeight=int_3, capture=save_picture)  # -> Output; disabled; plug-in component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
panel_12 = Panel(captureview)  # disabled
python_2 = GhPythonScript(imagePath=captureview)  # -> out, a; disabled
# ---------- python_2: Python ----------
import System


fileName =r'C:\Dev\WorkWithImage\cutImage.py'
pythonInterpreter = 'python.exe'

wrapperFile = '"' + imagePath + '"'
fileName = '"' + fileName + '"'

p = System.Diagnostics.Process()
p.StartInfo.RedirectStandardOutput = True
p.StartInfo.RedirectStandardError = True

p.StartInfo.UseShellExecute = False
p.StartInfo.CreateNoWindow = True

p.StartInfo.FileName = pythonInterpreter
p.StartInfo.Arguments = fileName + " " + wrapperFile + " " 
p.Start()
p.WaitForExit()

a = p.StandardOutput.ReadLine()
# ---------- end python_2 ----------
panel_13 = Panel(python_2.a)  # disabled
swatch_10 = ColourSwatch(SwatchColor=RGB(255, 255, 255))  # disabled

panel_14 = Panel("""Brick Analysis
Number of Elements: 
Computation Time: """)  # disabled
entwine = Entwine(Branch00=panel_8, Branch01=num_2, Branch02=panel_9, FlattenInputs=True)  # -> flatten(Result); disabled
panel_15 = Panel("")  # disabled
concat_4 = Concatenate(FragmentA=panel_14, FragmentB=entwine, FragmentC=panel_15)  # disabled
panel_16 = Panel(concat_4)  # disabled
number_slider_4 = Slider(15, range=1..100)  # disabled
number_slider_5 = Slider(30, range=1..100)  # disabled
number_slider_6 = Slider(57, range=1..100)  # disabled
lng = ListLength(List=concat_4)  # disabled
series = Series(Start=number_slider_6, Step=expr("x*2", number_slider_4), Count=lng)  # disabled
pt_5 = ConstructPoint(XCoordinate=number_slider_5, YCoordinate=series, ZCoordinate=0)  # disabled
panel_17 = Panel("Inconsolata")  # disabled
texttoscreen = RenderTextToScreen(Text=concat_4, Location=pt_5, Size=number_slider_4, Color=swatch_10, Font=panel_17, m_scWithvp=False)  # disabled

# ----
# Legend Panel
panel_18 = Panel("10")  # disabled
panel_19 = Panel("0.5")  # disabled
rectangle = Rectangle(Plane=PlaneXY(0, 0, 0), XSize=panel_19, YSize=panel_18, Radius=0)  # -> Rectangle, Length; disabled
rectangle_2 = Rectangle(Plane=PlaneXY(0, 0, 0), XSize=panel_18, YSize=panel_19, Radius=0)  # -> Rectangle, Length; disabled
panel_20 = Panel("1")  # disabled
boundary = BoundarySurfaces(Edges=rectangle_2.Rectangle)  # disabled
divide = DivideDomain(Domain=boundary, UCount=panel_20, VCount=10)  # disabled
divide_2 = DivideDomain(Domain=boundary, UCount=10, VCount=panel_20)  # disabled
subsrf = Isotrim(Surface=boundary, Domain=divide_2)  # disabled
explode = MeshExplode(Mesh=subsrf, Interpolate=False)  # disabled
mcol = MeshColours(Mesh=explode, Colours=graft(twnthrucols))  # -> flatten(Mesh); disabled
mjoin_3 = MeshJoin(Meshes=mcol)  # disabled
weldvertices_3 = MeshWeldVertices(Mesh=mjoin_3, Tolerance=0.01)  # -> RuntimeMessage, Mesh; disabled
pt_6 = ConstructPoint(XCoordinate=int, YCoordinate=int_2, ZCoordinate=0)  # disabled

multiplication_3 = Multiplication(A=number_slider_2, B=panel_18)  # disabled
division_2 = Division(A=multiplication_3, B=panel_5)  # disabled
X = UnitX(Factor=division_2)  # disabled
rev = Reverse(Vector=X)  # disabled
move = Move(Geometry=pt_6, Motion=rev)  # -> Geometry, Transform; disabled

meshtoscreen = RenderMeshToScreen(Mesh=weldvertices_3.Mesh, Location=move.Geometry, ScaleFactor=number_slider_2, Depth=0.95, Fixed=True, m_scWithvp=False)  # disabled

multiplication_4 = Multiplication(A=number_slider_2, B=panel_18)  # disabled
multiplication_5 = Multiplication(A=panel_19, B=number_slider_2)  # disabled
X_2 = UnitX(Factor=multiplication_4)  # disabled
move_2 = Move(Geometry=move.Geometry, Motion=X_2)  # -> Geometry, Transform; disabled
addition_2 = Addition(A=multiplication_5, B=multiplication_2)  # disabled
merge_4 = Merge(Data1=move.Geometry, Data2=move_2.Geometry)  # disabled
vec = VectorXYZ(XComponent=0, YComponent=addition_2, ZComponent=0)  # -> Vector, Length; disabled
move_3 = Move(Geometry=merge_4, Motion=vec.Vector)  # -> Geometry, Transform; disabled
texttoscreen_2 = RenderTextToScreen(Text=merge_3, Location=move_3.Geometry, Size=number_slider_3, Color=item_3, Font=panel_11, m_scWithvp=False)  # disabled
