# Grasshopper definition 1_Bridge_beam.gh (Grasshopper 1.0.7)
# plug-ins: Alpaca4d

# ---- group: Element
data = Data(0)
data_2 = Data(0)

# ---- group: Load
# instagram:    Alpaca4d
# facebook:     Alpaca4d
# mail:         alpaca4d@gmail.com
data_3 = Data(0)
data_4 = Data(0)

# ---- group: Cross-Section
data_5 = Data(0)
data_6 = Data(0)

# ---- group: Support
data_7 = Data(0)
data_8 = Data(0)

# ---- group: Material
data_9 = Data(0)
data_10 = Data(0)

# ---- group: Constraint
data_11 = Data(0)
data_12 = Data(0)

# ---- group: Material
division = Division(A="39000", B="2")
uniaxialmaterial = UniaxialMaterialAlpaca4d(MatName="cls", E="39000", G=division, V=0.3, Rho="25", Fy=23.5)

# ---- group: Cross-Section
division_2 = Division(A="2500", B="2")
circular_cross_section = CircularCrossSectionAlpaca4d(MarshallingSignalParameter="Circular", Diameter="2500", Thickness=division_2, UniaxialMaterial=uniaxialmaterial)

rectangular_hollow_section = RectangularHollowSectionAlpaca4d(SectionName="U", Base="2500", Height="7000", Thickness="400", UniaxialMaterial=uniaxialmaterial)

# ----
genes = GenePool(Decimals=2, Maximum=5, Minimum=-5, Value=[3.01, -2.542713973, 1.486445151, 4.93, -1.87, 5, -1.79, 1.85])
crv = Curve(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)
cp = ControlPoints(Curve=crv)  # -> Points, Weights, Knots
vec = VectorXYZ(XComponent="1", YComponent=0, ZComponent=0)  # -> Vector, Length
genes_2 = GenePool(Decimals=2, Maximum=1, Minimum=0, Value=[0, 0.2, 0.33, 0.53, 0.71, 0.87, 0.94, 1])

Y = UnitY(Factor=genes)
move = Move(Geometry=cp.Points, Motion=Y)  # -> Geometry, Transform

intcrv_t = InterpolateT(Vertices=move.Geometry, TangentStart=vec.Vector, TangentEnd=vec.Vector, KnotStyle=Slider(2, range=0..10))  # -> Curve, Length, Domain
eval = EvaluateCurve(Curve=reparameterize(intcrv_t.Curve), Parameter=genes_2)  # -> Point, Tangent, Angle
shatter = Shatter(Curve=reparameterize(intcrv_t.Curve), Parameters=genes_2)
project = Project(Geometry=eval.Point, Plane=PlaneXY(0, 0, 0))  # -> Geometry, Transform
pt = Point(project.Geometry)
pt_2 = Point(eval.Point)
divide = DivideCurve(Curve=shatter, Count=Slider(9, range=0..30), Kinks=False)  # -> Points, Tangents, Parameters
pline = PolyLine(Vertices=divide.Points, Closed=False)
explode = Explode(Curve=pline, Recursive=True)  # -> Segments, Vertices
ln = Line(StartPoint=pt, EndPoint=pt_2)

# ---- group: Load
cullpt = CullDuplicates(Points=flatten(explode.Vertices), Tolerance=0.1, CullMode=1)  # -> Points, Indices, Valence
lng = ListLength(List=cullpt.Points)
sort_pt = SortPoints(Points=cullpt.Points)  # -> Points, Indices
panel = Panel(lng)
item = ListItem(List=sort_pt.Points, Index=Slider(28, range=0..41), Wrap=True)
vec_2 = VectorXYZ(XComponent="20", YComponent=0, ZComponent="-400")  # -> Vector, Length
point_load = PointLoadAlpaca4d(Force=vec_2.Vector, Pos=sort_pt.Points)

# ---- group: Support
pt_3 = Point(pt)
toggle = BooleanToggle(True)
support = SupportAlpaca4d(Pos=pt_3, Tx=toggle, Ty=toggle, Tz=toggle, Rx=toggle, Ry=toggle, Rz=toggle)

# ---- group: Element
line_to_beam = LineToBeamAlpaca4d(
    Line=explode.Segments,
    MarshallingSignalParameter=ColourSwatch(SwatchColor=RGB(0, 237, 40)),
    CrossSection=rectangular_hollow_section)

line_to_beam_2 = LineToBeamAlpaca4d(Line=ln, MarshallingSignalParameter=ColourSwatch(SwatchColor=RGB(0, 107, 237)), CrossSection=circular_cross_section)

# ----
merge = Merge(Data1=line_to_beam, Data2=line_to_beam_2)
assemble_model = AssembleModelAlpaca4d(Element=flatten(merge), Support=flatten(support), Load=flatten(point_load))  # -> AlpacaModel, MassOfStructure
visualisemodel = VisualiseModelAlpaca4d(AlpacaModel=assemble_model.AlpacaModel, Model=Toggle(True), Support=Toggle(True), Load=Toggle(True))  # -> AlpacaModel, Model
geo = Geometry(visualisemodel.Model)
dash = DashPattern(Curve=visualisemodel.Model, Pattern=Slider(0.15, range=0..1))  # -> Dashes, Gaps
static_analyses = StaticAnalysesAlpaca4d(AlpacaModel=visualisemodel.AlpacaModel)

# ---- group: Post -Processing
gradientlibrary = GradientLibraryAlpaca4d(GradientIndex=Slider(12, range=0..12))  # -> reverse(ColorsList)
static_model_view = StaticModelViewAlpaca4d(
    AlpacaStaticOutput=static_analyses,
    Scale=Slider(1059, range=0..10000),
    ModelExtrude=Toggle(False),
    ColorList=gradientlibrary)  # -> ModelDisp, DisplacementRange
geo_2 = Geometry(static_model_view.ModelDisp)
