# Grasshopper definition ArcoBrick.gh (Grasshopper 1.0.7)
# plug-ins: treesloth01, Alpaca4d, Kangaroo2 Components

number_slider = Slider(7, range=0..10)
number_slider_2 = Slider(0.15, range=0..1)
number_slider_3 = Slider(0.15, range=0..1)
pt = ConstructPoint(XCoordinate=0, YCoordinate=0, ZCoordinate=0)
X = UnitX(Factor=number_slider)
addition = Addition(A=number_slider, B=Slider(2, range=0..10))
neg = Negative(Value=number_slider_2)
neg_2 = Negative(Value=number_slider_2)
move = Move(Geometry=pt, Motion=X)  # -> Geometry, Transform
concat = Concatenate(FragmentA=neg, FragmentC=" to ", FragmentB=number_slider_2)
concat_2 = Concatenate(FragmentA=neg_2, FragmentC=" to ", FragmentB=number_slider_2)
cat = Catenary(PointA=pt, PointB=move.Geometry, Length=addition, Gravity=Vector(0, 0, -1))
xy = XYPlane(Origin=Point(0, 0, 0))
rectangle = Rectangle(Plane=PlaneXY(0, 0, 0), XSize=concat_2, YSize=concat, Radius=0)  # -> Rectangle, Length
cone = Cone(Base=[pt, move.Geometry], Radius="0.2", Length="0.35")  # -> Cone, Tip
len = Length(Curve=cat)
mirror = Mirror(Geometry=cat, Plane=xy)  # -> Geometry, Transform
explode = Explode(Curve=rectangle.Rectangle, Recursive=True)  # -> Segments, Vertices
Z = UnitZ(Factor=Slider(0.24, range=0..1))  # -> expr("-x", UnitVector)
move_2 = Move(Geometry=cone.Cone, Motion=Z)  # -> Geometry, Transform
duppt = RemoveDuplicatePts(Points=explode.Vertices, Tolerance=0.01)
fcircle = CircleFit(Points=explode.Vertices)  # -> Circle, Radius, Deviation
divide = DivideCurve(Curve=mirror.Geometry, Count=Slider(70, range=0..100), Kinks=False)  # -> Points, Tangents, Parameters
alongcrv = SortAlongCurve(Points=duppt, Curve=fcircle.Circle)  # -> Points, Indices
conmesh = ConstructMesh(Vertices=alongcrv.Points, Faces={A=0, B=1, C=2, D=3})  # -> flatten(Mesh)
pframe = PerpFrame(Curve=mirror.Geometry, Parameter=divide.Parameters)
refine = Refine(Mesh=conmesh, Level="2")
deplane = DeconstructPlane(Plane=pframe)  # -> Origin, XAxis, YAxis, ZAxis
move_3 = Move(Geometry=refine, Motion=divide.Points)  # -> Geometry, Transform
Z_2 = UnitZ(Factor=1)
Y = UnitY(Factor=1)
angle = Angle(VectorA=deplane.ZAxis, VectorB=Z_2)  # -> Angle, Reflex
rot3d = Rotate3D(Geometry=graft(move_3.Geometry), Angle=graft(angle.Angle), Center=graft(divide.Points), Axis=Y)  # -> Geometry, Transform
mesh = Mesh(flatten(rot3d.Geometry))
first_last = FirstLast(List=mesh)  # -> FirstValue, LastValue
demesh = DeconstructMesh(Mesh=flatten([first_last.FirstValue, first_last.LastValue]))  # -> flatten(Vertices), Faces, Colours, Normals
demesh_2 = DeconstructMesh(Mesh=flatten(rot3d.Geometry))  # -> flatten(Vertices), Faces, Colours, Normals
mesh_series_to_brick = MeshSeriesToBrickAlpaca4d(MeshSeries=flatten(rot3d.Geometry))
duppt_2 = RemoveDuplicatePts(Points=demesh_2.Vertices, Tolerance=0.01)
ndmaterial = NDMaterialAlpaca4d(MatName="S235", E="31475", V=0.3, Rho="25", Fy=23.5)
toggle = BooleanToggle(True)
pdecon = Deconstruct(Point=duppt_2)  # -> XComponent, YComponent, ZComponent
toggle_2 = BooleanToggle(False)
bnd = Bounds(Numbers=pdecon.ZComponent)
brick_element = BrickElementAlpaca4d(Brick=mesh_series_to_brick, Colour=ColourSwatch(SwatchColor=RGB(47, 161, 96)), NDMaterial=ndmaterial)
number_slider_4 = Slider(0, range=0..100)
support = SupportAlpaca4d(Pos=demesh.Vertices, Tx=toggle, Ty=toggle, Tz=toggle, Rx=toggle_2, Ry=toggle_2, Rz=toggle_2)
dedomain = DeconstructDomain(Domain=bnd)  # -> Start, End
larger = LargerThan(FirstNumber=pdecon.ZComponent, SecondNumber=dedomain.End)  # -> LargerThan, OrEqualTo
cull = CullPattern(List=duppt_2, CullPattern=larger.OrEqualTo)
faceb = FaceBoundaries(Mesh=flatten(mesh_series_to_brick))
vec = VectorXYZ(XComponent=0, YComponent=0, ZComponent="-10")  # -> Vector, Length
dash = DashPattern(Curve=flatten(faceb), Pattern=Slider(0.1, range=0..1))  # -> Dashes, Gaps
multiplication = Multiplication(A=vec.Vector, B="0.1")
point_load = PointLoadAlpaca4d(Force=vec.Vector, Pos=cull)
Z_3 = UnitZ(Factor=multiplication)
preview = CustomPreview(Geometry=dash.Dashes, Material=ColourSwatch(SwatchColor=RGBA(209, 209, 209, 76)))
move_4 = Move(Geometry=cull, Motion=expr("-x", multiplication))  # -> Geometry, Transform
item = ListItem(List=move_4.Geometry, Index=0, Wrap=True)
assemble_model = AssembleModelAlpaca4d(Element=flatten(brick_element), Support=flatten(support), Load=flatten(point_load))  # -> AlpacaModel, MassOfStructure
vdisex = VectorDisplayEx(Point=item, Vector=multiplication, Colour=RGB(0, 0, 0), Width=Slider(3, range=0..10))
visualisemodel = VisualiseModelAlpaca4d(AlpacaModel=assemble_model.AlpacaModel, Support=Toggle(True), Load=Toggle(True))  # -> AlpacaModel, Model
geo = Geometry(visualisemodel.Model)
ndfanalyses = NDFAnalysesAlpaca4d(MarshallingSignalParameter=visualisemodel.AlpacaModel)
gradientlibrary = GradientLibraryAlpaca4d(GradientIndex=Slider(11, range=0..100))
gradientlibrary_2 = GradientLibraryAlpaca4d(GradientIndex=Slider(2, range=0..100))
brick_stress = BrickStressAlpaca4d(AlpacaStaticOutput=ndfanalyses, StressView=Slider(0, range=0..10), ColorList=gradientlibrary)  # -> Brick, StressValue, StressRange
static_model_view = StaticModelViewAlpaca4d(AlpacaStaticOutput=ndfanalyses, Scale=Slider(194, range=0..1000), ColorList=gradientlibrary_2)  # -> ModelDisp, DisplacementRange
legend = Legend(Colour=gradientlibrary_2, Tags=["One Fish", "Two Fish", "Red Fish", "Blue Fish"], LegendType=1)
geo_2 = Geometry(static_model_view.ModelDisp)
