# Grasshopper definition Brick.gh (Grasshopper 1.0.7)
# plug-ins: Pufferfish, Human, Alpaca4d, karambaGH

# ---- group: Element
data = Data(0)
data_2 = Data(0)

# ---- group: Load
# instagram:    Alpaca4d
# facebook:     Alpaca4d
# mail:         alpaca4d@gmail.com
data_3 = Data(0)
data_4 = Data(0)

# ---- group: Cross-Section
data_5 = Data(0)
data_6 = Data(0)

# ---- group: Support
data_7 = Data(0)
data_8 = Data(0)

# ---- group: Material
data_9 = Data(0)
data_10 = Data(0)

# ---- group: Constraint
data_11 = Data(0)
data_12 = Data(0)

# ----
crv = Curve([<curve referenced from the Rhino model> x3])
number_slider = Slider(4, range=1..5)
mesh_uv = MeshSurface(Surface=crv, UCount="2", VCount=number_slider, Overhang=True, Equalize=False)
range = Range(Domain="0 to 0.75", Steps="2")
Y = UnitY(Factor=range)
move = Move(Geometry=graft(mesh_uv), Motion=Y)  # -> Geometry, Transform
mesh_series_to_brick = MeshSeriesToBrickAlpaca4d(MeshSeries=move.Geometry)
preview = CustomPreview(Geometry=mesh_series_to_brick, Material=ColourSwatch(SwatchColor=RGB(255, 255, 255)))
panel = Panel("7000")
gradientlibrary = GradientLibraryAlpaca4d(GradientIndex=11)  # -> reverse(ColorsList); disabled
number_slider_2 = Slider(0.001, range=0.001..1)  # disabled
number_slider_3 = Slider(0.4278, range=0.001..1)  # disabled
mesh = Mesh()  # disabled
dom = ConstructDomain(DomainStart=number_slider_2, DomainEnd=number_slider_3)  # disabled

crv_2 = Curve([<curve referenced from the Rhino model> x4])

multiplication = Multiplication(A="10", B="2")

mesh_uv_2 = MeshSurface(Surface=crv_2, UCount=number_slider, VCount=multiplication, Overhang=True, Equalize=False)
move_2 = Move(Geometry=graft(mesh_uv_2), Motion=Y)  # -> Geometry, Transform
mesh_series_to_brick_2 = MeshSeriesToBrickAlpaca4d(MeshSeries=move_2.Geometry)

entwine = Entwine(Branch00=mesh_series_to_brick_2, Branch01=mesh_series_to_brick, FlattenInputs=True)
preview_2 = CustomPreview(Geometry=mesh_series_to_brick_2, Material=ColourSwatch(SwatchColor=RGB(110, 0, 0)))
clean = CleanTree(RemoveNulls=True, RemoveInvalid=True, RemoveEmpty=invert(False), Tree=entwine)
demesh = DeconstructMesh(Mesh=clean)  # -> flatten(Vertices), Faces, Colours, Normals

pt = Point(demesh.Vertices)
pdecon = Deconstruct(Point=pt)  # -> XComponent, YComponent, ZComponent
bnd = Bounds(Numbers=pdecon.ZComponent)
dedomain = DeconstructDomain(Domain=bnd)  # -> Start, End
addition = Addition(A="0.01", B=dedomain.Start)
smaller = SmallerThan(FirstNumber=pdecon.ZComponent, SecondNumber=addition)  # -> SmallerThan, OrEqualTo
dispatch = Dispatch(List=pt, DispatchPattern=smaller.SmallerThan)  # -> ListA, ListB
rdpoints = RemoveDuplicatePointsKaramba3D(Point=dispatch.ListA, LimitDistance=0.005)  # -> OutPoint, Info, Indexes

rdpoints_2 = RemoveDuplicatePointsKaramba3D(Point=dispatch.ListB, LimitDistance=0.005)  # -> OutPoint, Info, Indexes
jitter = Jitter(List=rdpoints_2.OutPoint, Jitter=1, Seed=2)  # -> Values, Indices
lng = ListLength(List=jitter.Values)
division = Division(A=lng, B="6")
split = SplitList(List=jitter.Values, Index=division)  # -> ListA, ListB
pt_2 = Point(split.ListA)

# ---- group: Load
vec = VectorXYZ(XComponent="1", YComponent=0, ZComponent=0)  # -> Vector, Length
point_load = PointLoadAlpaca4d(Force=vec.Vector, Pos=split.ListA)

# ---- group: Support
toggle = BooleanToggle(True)
support = SupportAlpaca4d(Pos=rdpoints.OutPoint, Tx=toggle, Ty=toggle, Tz=toggle, Rx=toggle, Ry=toggle, Rz=toggle)

# ---- group: Material
panel_2 = Panel("210000")

# ----
entwine_2 = Entwine(Branch00=panel_2, Branch01=panel_2, FlattenInputs=True)

# ---- group: Material (continued)
division_2 = Division(A=entwine_2, B=2)
ndmaterial = NDMaterialAlpaca4d(MatName="S235", E=entwine_2, G=division_2, V=0.3, Rho=78.5, Fy=23.5)

# ---- group: Element
swatch = ColourSwatch(SwatchColor=RGB(219, 33, 207))

# ----
entwine_3 = Entwine(Branch00=swatch, Branch01=ColourSwatch(SwatchColor=RGB(0, 255, 242)), FlattenInputs=True)

# ---- group: Element (continued)
brick_element = BrickElementAlpaca4d(Brick=simplify(clean), Colour=entwine_3, NDMaterial=simplify(ndmaterial))  # -> simplify(SolidWrapper)

# ----
assemble_model = AssembleModelAlpaca4d(Element=flatten(brick_element), Support=flatten(support), Load=flatten(point_load))  # -> AlpacaModel, MassOfStructure
visualisemodel = VisualiseModelAlpaca4d(AlpacaModel=assemble_model.AlpacaModel, Load=Toggle(True))  # -> AlpacaModel, Model
ndfanalyses = NDFAnalysesAlpaca4d(MarshallingSignalParameter=assemble_model.AlpacaModel)
geo = Geometry(visualisemodel.Model)
node_displacement = NodeDisplacementAlpaca4d(AlpacaStaticOutput=ndfanalyses)  # -> Points, Trans, Rot; disabled
gradientlibrary_2 = GradientLibraryAlpaca4d(GradientIndex=11)  # -> reverse(ColorsList); disabled
vlen = VectorLength(Vector=node_displacement.Trans)  # disabled
bnd_2 = Bounds(Numbers=vlen)  # disabled
remap = RemapNumbers(Value=vlen, Source=bnd_2, Target=Domain(0, 1))  # -> Mapped, Clipped; disabled
swatch_2 = ColourSwatch(SwatchColor=RGBA(255, 255, 255, 91))  # disabled
medges = MeshEdges(Mesh=mesh)  # -> NakedEdges, InteriorEdges, NonManifoldEdges; disabled
num = Number(expr("Round(x*1000,0)", vlen))  # disabled
twnthrucols = TweenThroughColors(
    Colors=gradientlibrary_2,
    Factor=remap.Mapped,
    Normalized=True,
    Equalized=False,
    Weighted=False,
    Degree=3,
    InterpolationType=0,
    Alpha=True)  # disabled
number_slider_4 = Slider(1, range=1..5)  # disabled
swatch_3 = ColourSwatch(SwatchColor=RGB(0, 0, 0))  # disabled
tag = TextTag(Location=node_displacement.Points, Text=num, Colour=twnthrucols)  # disabled
previewlw = CustomPreviewLineweights(Geometry=[medges.NakedEdges, medges.InteriorEdges], Shader=swatch_3, Thickness=number_slider_4, Absolute=False)  # disabled
galapagos = Galapagos(fitness=item)

# ---- group: Post -Processing
number_slider_5 = Slider(0, range=0..100)  # disabled
boolean_toggle = BooleanToggle(False)  # disabled
static_model_view = StaticModelViewAlpaca4d(AlpacaStaticOutput=ndfanalyses, Scale=number_slider_5, ModelExtrude=boolean_toggle, ColorList=gradientlibrary)  # -> ModelDisp, DisplacementRange; disabled
number_slider_6 = Slider(39, range=0..100)  # disabled
item = ListItem(List=static_model_view.DisplacementRange, Index=0, Wrap=True)  # -> Item, Item1; disabled
X = UnitX(Factor=number_slider_6)  # disabled
move_3 = Move(Geometry=static_model_view.ModelDisp, Motion=X)  # -> Geometry, Transform; disabled

# ----
mesh_2 = Mesh(static_model_view.ModelDisp)  # disabled

remap_2 = RemapNumbers(Value=vlen, Source=bnd_2, Target=dom)  # -> Mapped, Clipped; disabled
dots = DotDisplay(Point=node_displacement.Points, Colour=twnthrucols, Size=remap_2.Mapped)  # disabled
