# Grasshopper definition Brick2.gh (Grasshopper 1.0.7)
# plug-ins: MeshEdit Components, Pufferfish, Human, Alpaca4d, Weaverbird, Kangaroo2 Components

# ---- group: Element
data = Data(0)
data_2 = Data(0)

# ---- group: Load
# instagram:    Alpaca4d
# facebook:     Alpaca4d
# mail:         alpaca4d@gmail.com
data_3 = Data(0)
data_4 = Data(0)

# ---- group: Cross-Section
data_5 = Data(0)
data_6 = Data(0)

# ---- group: Support
data_7 = Data(0)
data_8 = Data(0)

# ---- group: Material
data_9 = Data(0)
data_10 = Data(0)

# ---- group: Constraint
data_11 = Data(0)
data_12 = Data(0)

# ---- group: variable
ncolumn = Slider(4, range=0..10)
number_slider = Slider(71, range=0..100)

# ----
rectangle = Rectangle(Plane=PlaneXY(0, 0, 0), XSize="40", YSize="20", Radius=0)  # -> Rectangle, Length
range = Range(Domain="0 to 2.0", Steps=Slider(3, range=2..4))
panel = Panel("""11
18
81
88""")

# ---- group: Material
division = Division(A="39000", B=2)
ndmaterial = NDMaterialAlpaca4d(MatName="S235", E="39000", G=division, V=0.3, Rho=78.5, Fy=23.5)

# ----
toggle = BooleanToggle(False)  # disabled
toggle_2 = BooleanToggle(True)  # disabled
gradientlibrary = Ladybug_GradientLibrary(gradIndex=Slider(7, range=0..23))  # -> customColors; plug-in component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
galapagos = Galapagos(fitness=item_2, gene=number_slider)
number_slider_2 = Slider(100, range=1..100)
number_slider_3 = Slider(0, range=0..5)  # disabled
swatch = ColourSwatch(SwatchColor=RGB(204, 0, 71))  # disabled
swatch_2 = ColourSwatch(SwatchColor=RGB(255, 182, 71))  # disabled
swatch_3 = ColourSwatch(SwatchColor=RGB(206, 255, 115))  # disabled
swatch_4 = ColourSwatch(SwatchColor=RGB(26, 180, 214))  # disabled
swatch_5 = ColourSwatch(SwatchColor=RGB(0, 0, 207))  # disabled
col = Colour(reverse([swatch, swatch_2, swatch_3, swatch_4, swatch_5]))  # disabled
panel_2 = Panel("0.15")  # disabled

# ----
# CHOOSE
# YOUR COLOUR
panel_3 = Panel("9")
range_2 = Range(Domain=Domain(0, 1), Steps=panel_3)
twnthrucols = TweenThroughColors(
    Colors=gradientlibrary,
    Factor=range_2,
    Normalized=True,
    Equalized=False,
    Weighted=False,
    Degree=3,
    InterpolationType=0,
    Alpha=True)

# ----
# Legend Panel
panel_4 = Panel("10")
rectangle_2 = Rectangle(Plane=PlaneXY(0, 0, 0), XSize="0.5", YSize=panel_4, Radius=0)  # -> Rectangle, Length
rectangle_3 = Rectangle(Plane=PlaneXY(0, 0, 0), XSize=panel_4, YSize="0.5", Radius=0)  # -> Rectangle, Length
boundary = BoundarySurfaces(Edges=rectangle_3.Rectangle)
divide = DivideDomain(Domain=boundary, UCount="1", VCount=10)
divide_2 = DivideDomain(Domain=boundary, UCount=10, VCount="1")
subsrf = Isotrim(Surface=boundary, Domain=divide_2)
explode = MeshExplode(Mesh=subsrf, Interpolate=False)
mcol = MeshColours(Mesh=explode, Colours=graft(twnthrucols))  # -> flatten(Mesh)
mjoin = MeshJoin(Meshes=mcol)
weldvertices = MeshWeldVertices(Mesh=mjoin, Tolerance=0.01)  # -> RuntimeMessage, Mesh
size_of_the_legend = Slider(30, range=10..30)
pt = ConstructPoint(XCoordinate=Slider(750, range=1..2000), YCoordinate=Slider(944, range=1..1000), ZCoordinate=0)
meshtoscreen = RenderMeshToScreen(Mesh=weldvertices.Mesh, Location=pt, ScaleFactor=Slider(54, range=1..70), Depth=0.95, Fixed=True, m_scWithvp=True)

number_slider_4 = Slider(1, range=0..10)
number_slider_5 = Slider(20, range=0..20)
mplane = MeshPlane(Boundary=rectangle.Rectangle, WidthCount=10, HeightCount=10)  # -> Mesh, Area
multiplication = Multiplication(A=number_slider_4, B=number_slider_5)
explode_2 = MeshExplode(Mesh=mplane.Mesh, Interpolate=False)
lng = ListLength(List=explode_2)
subtraction = Subtraction(A=multiplication, B=number_slider_4)
Z = UnitZ(Factor=subtraction)
subtraction_2 = Subtraction(A=lng, B=ncolumn)
Z_2 = UnitZ(Factor=range)
series = Series(Start=0, Step=number_slider_4, Count=number_slider_5)
move = Move(Geometry=graft(mplane.Mesh), Motion=Z)  # -> Geometry, Transform
reduce = RandomReduce(List=explode_2, Reduction=subtraction_2, Seed=number_slider)
Z_3 = UnitZ(Factor=series)
move_2 = Move(Geometry=graft(move.Geometry), Motion=Z_2)  # -> Geometry, Transform
mesh_series_to_brick = MeshSeriesToBrickAlpaca4d(MeshSeries=move_2.Geometry)  # -> flatten(Brick)

item = ListItem(List=explode_2, Index=panel, Wrap=True)
wbsplitquads = WeaverbirdsConstantQuadsSplitSubdivision(MeshCurves=item, Level="2", SmoothNakedEdges=0)

move_3 = Move(Geometry=graft(wbsplitquads), Motion=Z_3)  # -> Geometry, Transform
mesh_series_to_brick_2 = MeshSeriesToBrickAlpaca4d(MeshSeries=move_3.Geometry)  # -> flatten(Brick)
entwine = Entwine(Branch00=mesh_series_to_brick_2, Branch01=mesh_series_to_brick, FlattenInputs=True)
demesh = DeconstructMesh(Mesh=entwine)  # -> flatten(Vertices), Faces, Colours, Normals
cullpt = CullDuplicates(Points=flatten(demesh.Vertices), Tolerance=0.1, CullMode=3)  # -> Points, Indices, Valence
pdecon = Deconstruct(Point=cullpt.Points)  # -> XComponent, YComponent, ZComponent
bnd = Bounds(Numbers=pdecon.YComponent)
bnd_2 = Bounds(Numbers=pdecon.ZComponent)
pdecon_2 = Deconstruct(Point=cullpt.Points)  # -> XComponent, YComponent, ZComponent
dedomain = DeconstructDomain(Domain=bnd)  # -> Start, End
dedomain_2 = DeconstructDomain(Domain=bnd_2)  # -> Start, End
smaller = SmallerThan(FirstNumber=pdecon_2.ZComponent, SecondNumber=dedomain_2.Start)  # -> SmallerThan, OrEqualTo
larger = LargerThan(FirstNumber=pdecon.ZComponent, SecondNumber=dedomain_2.End)  # -> LargerThan, OrEqualTo
cull = CullPattern(List=cullpt.Points, CullPattern=smaller.OrEqualTo)
cull_2 = CullPattern(List=cullpt.Points, CullPattern=larger.OrEqualTo)

# ---- group: Element
brick_element = BrickElementAlpaca4d(Brick=entwine, Colour=ColourSwatch(SwatchColor=RGB(219, 33, 207)), NDMaterial=ndmaterial)  # -> simplify(SolidWrapper)

# ---- group: Load
vec = VectorXYZ(XComponent=0, YComponent="-100", ZComponent="-1000")  # -> Vector, Length
point_load = PointLoadAlpaca4d(Force=vec.Vector, Pos=cull_2)

# ---- group: Support
toggle_3 = BooleanToggle(True)
support = SupportAlpaca4d(Pos=cull, Tx=toggle_3, Ty=toggle_3, Tz=toggle_3, Rx=toggle_3, Ry=toggle_3, Rz=toggle_3)

# ----
assemble_model = AssembleModelAlpaca4d(Element=flatten(brick_element), Support=flatten(support), Load=flatten(point_load))  # -> AlpacaModel, MassOfStructure
visualisemodel = VisualiseModelAlpaca4d(AlpacaModel=assemble_model.AlpacaModel, Support=toggle_2, Load=toggle)  # -> AlpacaModel, Model; disabled
geo = Geometry(visualisemodel.Model)  # disabled
ndfanalyses = NDFAnalysesAlpaca4d(MarshallingSignalParameter=assemble_model.AlpacaModel)

# ---- group: Post -Processing
gradientlibrary_2 = GradientLibraryAlpaca4d(GradientIndex=Slider(8, range=0..12))
number_slider_6 = Slider(0, range=0..100)
static_model_view = StaticModelViewAlpaca4d(AlpacaStaticOutput=ndfanalyses, Scale=number_slider_2, ModelExtrude=Toggle(False), ColorList=gradientlibrary)  # -> ModelDisp, DisplacementRange
number_slider_7 = Slider(28, range=0..100)  # disabled
item_2 = ListItem(List=static_model_view.DisplacementRange, Index=0, Wrap=True)  # -> Item, Item1; disabled
X = UnitX(Factor=number_slider_7)  # disabled
move_4 = Move(Geometry=static_model_view.ModelDisp, Motion=X)  # -> Geometry, Transform; disabled

# ----
mesh = Mesh(static_model_view.ModelDisp)
clean = CombineClean(Meshes=mesh)
medges = MeshEdges(Mesh=clean)  # -> NakedEdges, InteriorEdges, NonManifoldEdges
dash = DashPattern(Curve=[medges.NakedEdges, medges.InteriorEdges, medges.NonManifoldEdges], Pattern=Slider(0.25, range=0.05..0.75))  # -> Dashes, Gaps
preview = CustomPreview(Geometry=dash.Dashes, Material=ColourSwatch(SwatchColor=RGB(102, 0, 255)))
brick_stress = BrickStressAlpaca4d(AlpacaStaticOutput=ndfanalyses, StressView=number_slider_3)  # -> Brick, StressValue, StressRange; disabled

# ---- group: value to plot
num = Number(brick_stress.StressValue)  # disabled

# ----
abs = Absolute(Value=num)  # disabled
demesh_2 = DeconstructMesh(Mesh=static_model_view.ModelDisp)  # -> Vertices, Faces, Colours, Normals; disabled
num_2 = Number(abs)  # disabled
bnd_3 = Bounds(Numbers=num_2)  # disabled
remap = RemapNumbers(Value=num_2, Source=bnd_3, Target=Domain(0, 1))  # -> Mapped, Clipped; disabled
twnthrucols_2 = TweenThroughColors(Factor=remap.Mapped, Normalized=True, Equalized=False, Weighted=False, Degree=3, InterpolationType=0, Alpha=True)  # disabled
dots = DotDisplay(Point=demesh_2.Vertices, Colour=twnthrucols_2, Size=panel_2)  # disabled

node_displacement = NodeDisplacementAlpaca4d(AlpacaStaticOutput=ndfanalyses)  # -> Points, Trans, Rot
vlen = VectorLength(Vector=node_displacement.Trans)
col_2 = Colour(reverse([ColourSwatch(SwatchColor=RGB(204, 0, 71)), ColourSwatch(SwatchColor=RGB(255, 182, 71)), ColourSwatch(SwatchColor=RGB(206, 255, 115)), ColourSwatch(SwatchColor=RGB(26, 180, 214)), ColourSwatch(SwatchColor=RGB(0, 0, 207))]))

multiplication_2 = Multiplication(A=node_displacement.Trans, B=number_slider_2)
move_5 = Move(Geometry=node_displacement.Points, Motion=multiplication_2)  # -> Geometry, Transform

# ---- group: value to plot
num_3 = Number(vlen)

# ----
abs_2 = Absolute(Value=num_3)
num_4 = Number(abs_2)
bnd_4 = Bounds(Numbers=num_4)
remap_2 = RemapNumbers(Value=num_4, Source=bnd_4, Target=Domain(0, 1))  # -> Mapped, Clipped
twnthrucols_3 = TweenThroughColors(
    Colors=gradientlibrary,
    Factor=remap_2.Mapped,
    Normalized=True,
    Equalized=False,
    Weighted=False,
    Degree=3,
    InterpolationType=0,
    Alpha=True)
num_5 = Number(expr("round(x*1000,2)", abs_2))  # disabled
tag = TextTag(Location=move_5.Geometry, Text=num_5, Colour=twnthrucols_3)  # disabled
preview_2 = CustomPreview(Material=twnthrucols_3)

dots_2 = DotDisplay(Point=move_5.Geometry, Colour=twnthrucols_3, Size="0.25")
