# Grasshopper definition 6_VaultShell_staticAnalysis.gh (Grasshopper 1.0.7)
# plug-ins: Alpaca4d, Kangaroo2 Components

# ---- group: Element
data = Data(0)
data_2 = Data(0)

# ---- group: Load
# instagram:    Alpaca4d
# facebook:     Alpaca4d
# mail:         alpaca4d@gmail.com
data_3 = Data(0)
data_4 = Data(0)

# ---- group: Cross-Section
data_5 = Data(0)
data_6 = Data(0)

# ---- group: Support
data_7 = Data(0)
data_8 = Data(0)

# ---- group: Material
data_9 = Data(0)
data_10 = Data(0)

# ---- group: Constraint
data_11 = Data(0)
data_12 = Data(0)

# ---- group: Material
division = Division(A="39000", B="2")
ndmaterial_alpaca4d = NDMaterialAlpaca4d(MatName="S235", E="39000", G=division, V=0.3, Rho="25", Fy=23.5)

# ---- group: Cross-Section
shell_section_alpaca4d = ShellSectionAlpaca4d(SectionName="Cls", Thickness="150", NDMaterial=ndmaterial_alpaca4d)

# ----
gradientlibrary = GradientLibraryAlpaca4d(GradientIndex=Slider(1, range=0..12))  # -> reverse(ColorsList)
merge = Merge(Data1=ColourSwatch(SwatchColor=RGB(0, 17, 255)))

# ---- group: Model
mesh = Mesh(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)
refine = Refine(Mesh=mesh, Level=Slider(1, range=0..10))
deconstruct_mesh = DeconstructMesh(Mesh=refine)  # -> Vertices, Faces, Colours, Normals

# ----
medges = MeshEdges(Mesh=refine)  # -> NakedEdges, InteriorEdges, NonManifoldEdges
preview = CustomPreview(Geometry=medges.NakedEdges, Material=ColourSwatch(SwatchColor=RGB(0, 0, 0)))
preview_2 = CustomPreview(Geometry=medges.InteriorEdges, Material=ColourSwatch(SwatchColor=RGB(135, 135, 135)))
duppt = RemoveDuplicatePts(Points=flatten(deconstruct_mesh.Vertices), Tolerance=0.01)

# ---- group: Model (continued)
deconstruct = Deconstruct(Point=duppt)  # -> XComponent, YComponent, ZComponent
equality = Equality(FirstNumber=deconstruct.ZComponent, SecondNumber="0")  # -> Equality, Inequality
dispatch = Dispatch(List=duppt, DispatchPattern=equality.Equality)  # -> ListA, ListB

# ---- group: Load
vector_xyz = VectorXYZ(XComponent="0", YComponent=0, ZComponent="-40")  # -> Vector, Length
point_load_alpaca4d = PointLoadAlpaca4d(Force=vector_xyz.Vector, Pos=dispatch.ListB)

# ---- group: Element
mesh_to_shell_alpaca4d = MeshToShellAlpaca4d(Mesh=refine, Colour=ColourSwatch(SwatchColor=RGB(0, 91, 237)), CrossSection=shell_section_alpaca4d)

# ---- group: Support
toggle = BooleanToggle(True)
toggle_2 = BooleanToggle(True)
point = Point(dispatch.ListA)
support = SupportAlpaca4d(Pos=point, Tx=toggle, Ty=toggle, Tz=toggle, Rx=toggle_2, Ry=toggle_2, Rz=toggle)

# ----
assemble_model_alpaca_4d = AssembleModelAlpaca4d(Element=flatten(mesh_to_shell_alpaca4d), Support=flatten(support), Load=flatten(point_load_alpaca4d))  # -> AlpacaModel, MassOfStructure
visualisemodel = VisualiseModelAlpaca4d(AlpacaModel=assemble_model_alpaca_4d.AlpacaModel, Model=Toggle(True), Support=Toggle(True), Load=Toggle(False))  # -> AlpacaModel, Model
static_analyses_alpaca4d = StaticAnalysesAlpaca4d(AlpacaModel=visualisemodel.AlpacaModel)

# ---- group: Post -Processing
gradientlibrary_2 = GradientLibraryAlpaca4d(GradientIndex=Slider(12, range=0..12))  # -> reverse(ColorsList)
static_model_view = StaticModelViewAlpaca4d(
    AlpacaStaticOutput=static_analyses_alpaca4d,
    Scale=Slider(48, range=0..100),
    ModelExtrude=Toggle(False),
    ColorList=gradientlibrary_2)  # -> ModelDisp, DisplacementRange
geo = Geometry(static_model_view.ModelDisp)
item = ListItem(List=static_model_view.DisplacementRange, Index=0, Wrap=True)  # -> Item, Item1

# ----
multiplication = Multiplication(A=item.Item1, B=Slider(1000, range=0..1000))
shell_stress_alpaca4d = ShellStressAlpaca4d(AlpacaStaticOutput=static_analyses_alpaca4d, StressView=Slider(3, range=0..7), ColorList=gradientlibrary)  # -> Shell, StressValue, StressRange
