# Grasshopper definition 9_ArcModel.gh (Grasshopper 1.0.7)
# plug-ins: Alpaca4d, Kangaroo2 Components

# ---- group: Element
data = Data(0)
data_2 = Data(0)

# ---- group: Load
data_3 = Data(0)
# instagram:    Alpaca4d
# facebook:     Alpaca4d
# mail:         alpaca4d@gmail.com
data_4 = Data(0)

# ---- group: Cross-Section
data_5 = Data(0)
data_6 = Data(0)

# ---- group: Support
data_7 = Data(0)
data_8 = Data(0)

# ---- group: Material
data_9 = Data(0)
data_10 = Data(0)

# ---- group: Constraint
data_11 = Data(0)
data_12 = Data(0)

# ---- group: Material
uniaxialmaterial = UniaxialMaterialAlpaca4d(MatName="Concrete", E=210000, V=0.3, Rho=78.5, Fy=23.5)

# ---- group: Cross-Section
double_t_section = DoubleTSectionAlpaca4d(SectionName="IPE", Bsup="400", Binf="400", H="1000", Tsup="20", Tinf="20", Tw="20", UniaxialMaterial=uniaxialmaterial)

# ----
construct_point = ConstructPoint(XCoordinate=0, YCoordinate=0, ZCoordinate=0)
X = UnitX(Factor=Slider(50, range=0..100))
division = Division(A=X, B="2")
vec = VectorXYZ(XComponent=division, YComponent=0, ZComponent="20")  # -> Vector, Length
move = Move(Geometry=construct_point, Motion=vec.Vector)  # -> Geometry, Transform
move_2 = Move(Geometry=construct_point, Motion=X)  # -> Geometry, Transform

entwine = Entwine(Branch00=construct_point, Branch01=move.Geometry, Branch02=move_2.Geometry, FlattenInputs=True)  # -> flatten(Result)
intcrv = Interpolate(Vertices=entwine, Degree=3, Periodic=False, KnotStyle=1)  # -> Curve, Length, Domain

divide = DivideCurve(Curve=intcrv.Curve, Count=Slider(5, range=0..100), Kinks=False)  # -> Points, Tangents, Parameters
pline = PolyLine(Vertices=divide.Points, Closed=False)
explode = Explode(Curve=pline, Recursive=True)  # -> flatten(Segments), Vertices
cullpt = CullDuplicates(Points=flatten(explode.Vertices), Tolerance=0.1, CullMode=3)  # -> Points, Indices, Valence

dupln = RemoveDuplicateLines(Lines=explode.Segments, Tolerance=0.01)

# ---- group: Support
pdecon = Deconstruct(Point=flatten(cullpt.Points))  # -> XComponent, YComponent, ZComponent
smaller = SmallerThan(FirstNumber=pdecon.ZComponent, SecondNumber="0")  # -> SmallerThan, OrEqualTo
dispatch = Dispatch(List=flatten(cullpt.Points), DispatchPattern=smaller.OrEqualTo)  # -> ListA, ListB
pt = Point(dispatch.ListB)
pt_2 = Point(dispatch.ListA)
boolean_toggle = BooleanToggle(True)
support_alpaca4d = SupportAlpaca4d(
    Pos=pt_2,
    Tx=boolean_toggle,
    Ty=boolean_toggle,
    Tz=boolean_toggle,
    Rx=boolean_toggle,
    Ry=boolean_toggle,
    Rz=boolean_toggle)

# ---- group: Load
vector_xyz = VectorXYZ(XComponent="-30", YComponent=0, ZComponent="-300")  # -> Vector, Length
point_load = PointLoadAlpaca4d(Force=vector_xyz.Vector, Pos=pt)

# ---- group: Element
line_to_beam = LineToBeamAlpaca4d(Line=dupln, Colour=ColourSwatch(SwatchColor=RGB(0, 237, 40)), CrossSection=double_t_section)

# ----
assemble_model_alpaca_4d = AssembleModelAlpaca4d(Element=flatten(line_to_beam), Support=flatten(support_alpaca4d), Load=flatten(point_load))  # -> AlpacaModel, MassOfStructure
static_analyses_alpaca4d = StaticAnalysesAlpaca4d(AlpacaModel=assemble_model_alpaca_4d.AlpacaModel)

# ---- group: Post -Processing
gradientlibrary = GradientLibraryAlpaca4d(GradientIndex=Slider(12, range=0..12))  # -> reverse(ColorsList)
static_model_view = StaticModelViewAlpaca4d(
    AlpacaStaticOutput=static_analyses_alpaca4d,
    Scale=Slider(33, range=0..10000),
    ModelExtrude=Toggle(False),
    ColorList=gradientlibrary)  # -> ModelDisp, DisplacementRange
