# Grasshopper definition City.gh (Grasshopper 1.0.7)
# plug-ins: Pufferfish, Chromodoris, Human, Alpaca4d, karambaGH

rectangle = Rectangle(Plane=PlaneXY(0, 0, 0), XSize="0 to 20", YSize="0 to 20", Radius=0)  # -> Rectangle, Length
pop2d = Populate2D(Region=rectangle.Rectangle, Count="20", Seed=1)
sqgrid = Square(Plane=PlaneXY(0, 0, 0), Size="6", ExtentX="3", ExtentY="3")  # -> Cells, Points
rdpoints = RemoveDuplicatePointsKaramba3D(Point=flatten(pop2d), LimitDistance=0.005)  # -> OutPoint, Info, Indexes
lng = ListLength(List=rdpoints.OutPoint)
random = Random(Range=Domain(0, 1), Number=lng, Seed=2)
panel = Panel("""3
6""")
lng_2 = ListLength(List=rdpoints.OutPoint)  # -> expr("x-1", Length)
int = Integer(random)
range = Range(Domain="2 to 6.00", Steps=lng_2)
item = ListItem(List=panel, Index=int, Wrap=True)
Z = UnitZ(Factor=1)
line = LineSDL(Start=rdpoints.OutPoint, Direction=Z, Length=item)
panel_2 = Panel("3")  # disabled
uniaxialmaterial = UniaxialMaterialAlpaca4d(MatName="S235", E=210000, V=0.3, Rho=78.5, Fy=23.5)
divide = DivideCurve(Curve=line, Count=panel_2, Kinks=False)  # -> Points, Tangents, Parameters; disabled
pline = PolyLine(Vertices=simplify(divide.Points), Closed=False)  # disabled
explode = Explode(Curve=line, Recursive=True)  # -> Segments, Vertices
split = SplitList(List=explode.Vertices, Index="1")  # -> ListA, ListB
circular_cross_section = CircularCrossSectionAlpaca4d(SectionName="CHS", Diameter="250", Thickness="12.5", UniaxialMaterial=uniaxialmaterial)
toggle = BooleanToggle(True)
line_to_beam = LineToBeamAlpaca4d(Line=explode.Segments, CrossSection=circular_cross_section)
support = SupportAlpaca4d(Pos=split.ListA, Tx=toggle, Ty=toggle, Tz=toggle, Rx=toggle, Ry=toggle, Rz=toggle)
mass_point = MassPointAlpaca4d(NodalMass="200", Pos=split.ListB)
path = FilePath("C:\GitHub\Alpaca4d\FileFood4Rhino\Example\EarthQuakeOnACity\A10000.dat")
python = GhPythonScript(DatFile=path, dt="0.005", read=Toggle(True))  # -> out, timeStep, timeSeries; inputs read: Boolean
# ---------- python: Python ----------
def readDatFile(DatFile, dt):
    timeSeries = []
    timeStep = []
    
    if read:
        with open(DatFile) as file:
            file = file.readlines()
            time = 0.00
            for lines in file:
                line = lines.strip(" ").split("  ")
                for number in line:
                    time += dt
                    timeSeries.append(float(number))
                    timeStep.append(time)
    return timeSeries, timeStep

checkData = True

if not DatFile:
    checkData = False
    ghenv.Component.AddMessageForWarnings("'DatFile' failed to collect data")

if not dt:
    checkData = False
    ghenv.Component.AddMessageForWarnings("'dt' failed to collect data")


if checkData == True:
    timeSeries, timeStep = readDatFile(DatFile, dt)
# ---------- end python ----------
assemble_model = AssembleModelAlpaca4d(Element=flatten(line_to_beam), Support=flatten(support), Mass=flatten(mass_point))  # -> AlpacaModel, MassOfStructure
toggle_2 = BooleanToggle(False)  # disabled
panel_3 = Panel(assemble_model.MassOfStructure)  # disabled
static_analyses = StaticAnalysesAlpaca4d(AlpacaModel=assemble_model.AlpacaModel)  # disabled
dom = ConstructDomain(DomainStart=0, DomainEnd=Slider(202, range=1..1000))
dom_2 = ConstructDomain(DomainStart=0, DomainEnd=Slider(893, range=1..1000))
bnd = Bounds(Numbers=python.timeSeries)
bnd_2 = Bounds(Numbers=python.timeStep)
visualisemodel = VisualiseModelAlpaca4d(AlpacaModel=assemble_model.AlpacaModel, Mass=toggle_2)  # -> AlpacaModel, Model; disabled
remap = RemapNumbers(Value=python.timeSeries, Source=bnd, Target=dom)  # -> Mapped, Clipped
remap_2 = RemapNumbers(Value=python.timeStep, Source=bnd_2, Target=dom_2)  # -> Mapped, Clipped
ground_motion_analysis = GroundMotionAnalysisAlpaca4d(
    AlpacaModel=assemble_model.AlpacaModel,
    TmaxAnalyses="39.95",
    GroundMotionDirection="2",
    GroundMotionValues=python.timeSeries,
    GroundMotionTimeStep=python.timeStep,
    TimeStepIncrement="0.005")  # -> AlpacaGroundmotionOutput, MaxDisplacement, MinDisplacement
number_slider = Slider(3425, range=0..7989)
number_slider_2 = Slider(50, range=1..50)
pt = ConstructPoint(XCoordinate=remap_2.Mapped, YCoordinate=remap.Mapped, ZCoordinate=0)
number_slider_3 = Slider(50, range=1..200)
gradientlibrary = GradientLibraryAlpaca4d(GradientIndex=11)
pline_2 = PolyLine(Vertices=pt, Closed=False)
pt_2 = ConstructPoint(XCoordinate=Slider(63, range=0..1000), YCoordinate=Slider(756, range=0..2000), ZCoordinate=0)
ground_motion_model_view = GroundMotionModelViewAlpaca4d(
    AlpacaGroundmotionOutput=ground_motion_analysis.AlpacaGroundmotionOutput,
    Speed=number_slider_3,
    Animate=Toggle(False),
    Reset=Button(),
    Scale="50",
    Direction="3",
    ModelExtrude=Toggle(False),
    ColorList=gradientlibrary)  # -> ModelDisp, PointPos, PointDisp, Trans
partition = PartitionList(List=pt, Size=number_slider_3)
item_2 = ListItem(List=partition, Index=0, Wrap=True)
partition_2 = PartitionList(Size=[3, 2])
item_3 = ListItem(List=ground_motion_model_view.PointPos, Index=0, Wrap=True)
rec = DataRecorder(item_3, DataLimit=-10, RecordData=True)
crvtoscreen = RenderCurveToScreen(
    Curve=pline_2,
    Location=pt_2,
    ScaleFactor=1,
    Color=ColourSwatch(SwatchColor=RGB(0, 0, 0)),
    Thickness=Slider(3, range=1..100),
    Depth=0.95,
    Fixed=True,
    m_scWithvp=False)
lng_3 = ListLength(List="20")
crv = Curve(graft(line))
lng_4 = ListLength(List=rec)
explode_2 = Explode(Curve=ground_motion_model_view.ModelDisp, Recursive=True)  # -> Segments, Vertices
random_2 = Random(Range=Domain(0, 1), Number=lng_3, Seed="1000")
multiplication = Multiplication(A=lng_4, B=number_slider_3)
lng_5 = ListLength(List=explode_2.Vertices)  # -> expr("x-1", Length)
random_3 = Random(Range="-1 to 1.00", Number=lng_3, Seed=lng_3)  # -> graft(Random)
item_4 = ListItem(List=pt, Index=multiplication, Wrap=True)
random_4 = Random(Range="-1 to 1.00", Number=1, Seed=random_2)
divide_2 = DivideCurve(Curve=crv, Count=lng_5, Kinks=False)  # -> Points, Tangents, Parameters
neg = Negative(Value=random_3)
neg_2 = Negative(Value=random_4)
pttoscreen = RenderPointToScreen(Point=item_4, Location=pt_2, ScaleFactor=1, Radius=Slider(6, range=1..12), Depth=0.95, Fixed=True, m_scWithvp=False)
dom_3 = ConstructDomain(DomainStart=neg, DomainEnd=random_3)  # -> simplify(Domain)
dom_4 = ConstructDomain(DomainStart=neg_2, DomainEnd=random_4)  # -> simplify(Domain)
panel_4 = Panel(dom_4)
vlen = VectorLength(Vector=flatten(ground_motion_model_view.Trans))
rectangle_2 = Rectangle(Plane=divide_2.Points, XSize=dom_4, YSize=dom_3, Radius=0)  # -> Rectangle, Length
rectangle_3 = Rectangle(Plane=explode_2.Vertices, XSize=dom_4, YSize=dom_3, Radius=0)  # -> Rectangle, Length
bnd_3 = Bounds(Numbers=vlen)
mloft = MeshLoft(Polylines=rectangle_2.Rectangle, Cap=False)
medges = MeshEdges(Mesh=mloft)  # -> NakedEdges, InteriorEdges, NonManifoldEdges
mloft_2 = MeshLoft(Polylines=rectangle_3.Rectangle, Cap=False)
demesh = DeconstructMesh(Mesh=mloft)  # -> Vertices, Faces, Colours, Normals
demesh_2 = DeconstructMesh(Mesh=mloft_2)  # -> Vertices, Faces, Colours, Normals
dash = DashPattern(Curve=[medges.NakedEdges, medges.InteriorEdges, medges.NonManifoldEdges], Pattern=Slider(0.068, range=0..1))  # -> Dashes, Gaps
gradientlibrary_2 = GradientLibraryAlpaca4d(GradientIndex=11)  # -> reverse(ColorsList)
pt_3 = Point(demesh.Vertices)
pt_4 = Point(demesh_2.Vertices)
crv_2 = Curve(dash.Dashes)
dist = Distance(PointA=pt_3, PointB=pt_4)
remap_3 = RemapNumbers(Value=dist, Source="0.5", Target=Domain(0, 1))  # -> Mapped, Clipped
twnthrucols = TweenThroughColors(
    Colors=gradientlibrary_2,
    Factor=remap_3.Mapped,
    Normalized=True,
    Equalized=False,
    Weighted=False,
    Degree=3,
    InterpolationType=0,
    Alpha=True)  # -> simplify(Tween)
lng_6 = ListLength(List=twnthrucols)
multiplication_2 = Multiplication(A=lng_6, B=4)
repeat = RepeatData(Data=twnthrucols, Length=multiplication_2)
conmesh = ConstructMesh(Vertices=demesh_2.Vertices, Faces=demesh_2.Faces, Colours=twnthrucols)
