# Grasshopper definition fattenerColumn.gh (Grasshopper 1.0.7)
# plug-ins: MeshEdit Components, treesloth01, Pufferfish, Fattener, Human, Alpaca4d, Weaverbird, ggRhinoIFC, karambaGH

gggrasshoppersettings = GgGrasshopperSettings(
    SettingsData_IFCSettings_Format="STEP",
    SettingsData_IFCSettings_GenerateOwnerHistory=True,
    SettingsData_IFCSettings_IdentifyObsolete=True,
    SettingsData_IFCSettings_LastUsedUnits="Meters",
    SettingsData_IFCSettings_Radians=True,
    SettingsData_IFCSettings_RepMapExport="NONE",
    SettingsData_IFCSettings_Target="Universal",
    SettingsData_IFCSettings_VersionIFC="IFC2x3",
    SettingsData_RevitSettings_Format="STEP",
    SettingsData_RevitSettings_GenerateOwnerHistory=True,
    SettingsData_RevitSettings_IdentifyObsolete=True,
    SettingsData_RevitSettings_LastUsedUnits="Meters",
    SettingsData_RevitSettings_Radians=True,
    SettingsData_RevitSettings_RepMapExport="NONE",
    SettingsData_RevitSettings_Target="Universal",
    SettingsData_RevitSettings_VersionIFC="IFC4")
cir = Circle(Plane=PlaneXY(0, 0, 0), Radius=1)
panel = Panel("4")
divide = DivideCurve(Curve=cir, Count=Slider(11, range=2..15), Kinks=False)  # -> Points, Tangents, Parameters
pt = Point(divide.Points)
neg = Negative(Value=Slider(2.334, range=0..10))
avr = Average(Input=pt)
Z = UnitZ(Factor=neg)
move = Move(Geometry=avr, Motion=Z)  # -> Geometry, Transform

# ---- group: Sample Outer Nodes Along Multiple Beams
outernodes = Point([pt, move.Geometry])

# ----
merge = Merge(Data1=simplify(outernodes))

# ---- group: Generate Cable Network
outernodetolerance = Slider(0.12, range=0.01..0.5)
minedgelength = Slider(0.18, range=0..5)
relaxations = Slider(10, range=0..10)
list = ValueList({"Spring": "spring", "ConstantTension": "constantTension"}, selected="Spring")
prunesort = BooleanToggle(True)
outernodes_2 = Point(flatten(outernodes))
gcn = GenerateCableNetwork(
    OuterNodes=outernodes_2,
    RelaxMode=list,
    RelaxIterations=relaxations,
    OuterNodeTolerance=outernodetolerance,
    MinEdgeLength=minedgelength,
    PruneSort=prunesort,
    densityForce=Slider(1, range=1..20))  # -> Cables, EdgeSum; inputs OuterNodes: list
# ---------- gcn: Python ----------
"""
Generates a cable network using the closest pair algoritm based on a set
of points (OuterNodes).

    Inputs:
        OuterNodes: The outer nodes from which to generate the cable network {list,point3d}
        RelaxMode: The Kangaroo2 goal used to relax the network (spring or constantTension, note constantTension might break stuff) {item,str}
        RelaxIterations: Amount of relaxation iterations {item,int}
        OuterNodeTolerance: Outer nodes within less than this value will be collapsed prior to generating the network {item,float}
        PruneSort: Sort the network edges by their topological distance to the outer nodes {item,bool}
    Outputs:
        Edges: The edges (i.e. cables) of the network {list,line}
        EdgeSum: The total distance of the network (i.e. sum of all cable lengths) {item,float}
    Remarks:
        Author: Anders Holden Deleuran
        License: Apache License 2.0
        Version: 160820
"""
ghenv.Component.Name = "GenerateCableNetwork"
ghenv.Component.NickName ="GCN"
ghenv.Component.Category = "CM_FAHS"
ghenv.Component.SubCategory = "2 Assembly Geometry"

import copy
import Rhino as rc
import Grasshopper as gh
import clr
#clr.AddReferenceToFile("KangarooSolver.dll")
clr.AddReferenceToFileAndPath("C:\Program Files\Rhino 6\Plug-ins\Grasshopper\Components\KangarooSolver.dll")

import KangarooSolver as ks
from System.Collections.Generic import List
import itertools

def listToTree(list):
    
    """ Convert a nested Python list to a GH datatree """
    
    tree = gh.DataTree[object]()
    for i,l in enumerate(list):
        tree.AddRange(l,gh.Kernel.Data.GH_Path(i))
        
    return tree

def averagePoints(pts):
    
    """ Get the average point for a list of points """
    
    avrPt = rc.Geometry.Point3d(0,0,0)
    for pt in pts:
        avrPt += pt
    avrPt = avrPt/len(pts)
    
    return avrPt

def closestPair(points):
    
    """ Returns the indices of the two closest points in the list """
    
    # Make searchable point list
    sPts = rc.Collections.Point3dList(points)
    
    # Connect all points
    pairs = []
    for pt in points:
        
        # Get closest point in list that isn't this point
        sPts.Remove(pt)
        clPt = sPts.ClosestPointInList(sPts,pt)
        sPts.Add(pt)
        
        # Make line from this point to closest point
        l = rc.Geometry.Line(pt,clPt)
        pairs.append(l)
        
    # Sort pair lines by length and get first item at proximity factor
    pairs = sorted(pairs, key = lambda l: l.Length)
    pickedPair = pairs[0]
    
    # Get the indices of the two points forming the closest pair
    startID = sPts.ClosestIndex(pickedPair.From)
    endID = sPts.ClosestIndex(pickedPair.To)
    
    return startID,endID

def makeProximityPairingNetwork(points):
    
    """ Iteratively pairs a list of points by proximity,
    returns the pairs as a network of connected lines """
    
    # Pair the points
    i = 0
    pairs = []
    while len(points) > 1:
        
        # Get closest point pair and 
        startID,endID = closestPair(points)
        
        # Get and remove pair from pointlist
        startPt = points.pop(startID)
        endPt = points.pop(endID-1)
        
        # Make midpoint and add it to point list
        midPt = (startPt + endPt)/2
        points.append(midPt)
        
        # Make pair line
        l = rc.Geometry.Line(startPt,endPt)
        pairs.append(l)
        
        # Break out of loop
        i += 1
        if i > 1000:
            break
            
    return pairs

def splitPairs(pairs,skipLast):
    
    """ split the pair lines at their midpoint """
    
    edges = []
    for i,l in enumerate(pairs):
        if i == len(pairs)-1 and skipLast:
            edges.append(l)
        else:
            midPt = (l.From + l.To)/2
            lA = rc.Geometry.Line(l.From,midPt)
            lB = rc.Geometry.Line(l.To,midPt)
            edges.extend((lA,lB))
            
    return edges

def relaxNetwork(edges,anchors,iterations,tol,mode,densityForce):
    
    """ Relax a line network using Kangaroo2 """
    
    if iterations == 0:
        return edges
        
    else:
        
        # Make goals list
        goals = []
        for l in edges:
            if mode == "spring":
                g = ks.Goals.Spring(l.From,l.To,0.00,densityForce)
            elif mode == "constantTension":
                g = ks.Goals.ConstantTension(l.From,l.To,-0.1) # Maybe play around with this
            goals.append(g)
            
        for pt in anchors:
            g = ks.Goals.Anchor(pt,1000000)
            goals.append(g)
        
        # Make solver system and goals dotnet list
        ps = ks.PhysicalSystem()
        goalsList = List[ks.IGoal]()
        
        # Assign indexes to the particles in each Goal
        for g in goals:
            ps.AssignPIndex(g,tol)
            goalsList.Add(g)
            
        # Solve system
        for i in range(int(iterations)):
            ps.Step(goalsList,False,1000)
            
        # Get edges
        relaxedEdges = []
        for o in ps.GetOutput(goalsList):
            if type(o) is rc.Geometry.Line:
                relaxedEdges.append(o)
                
        return relaxedEdges

def linesTipTouch(lA,lB,tol):
    
    """ Returns true if two lines touch tip-to-tip within tolerance """
    
    # Get distances from tip to tip
    d0 = lA.From.DistanceTo(lB.From)
    d1 = lA.To.DistanceTo(lB.To)
    d2 = lA.To.DistanceTo(lB.From)
    d3 = lB.To.DistanceTo(lA.From)
    distances = (d0,d1,d2,d3)
    
    # Check distances and set touch boolean
    dCheck = [d <= tol for d in distances]
    if True in dCheck:
        tipTouch = True
    else:
        tipTouch = False
        
    return tipTouch

def groupConnectedEdges(edges,tol):
    
    """ Group a network of edges by its connected components """
    
    # Get indices of which edge each edge touches
    touchIndices = []
    for i,lA in enumerate(edges):
        tIDs = [i]
        for j,lB in enumerate(edges):
            if lA is not lB:
                if linesTipTouch(lA,lB,tol):
                    tIDs.append(j)
        touchIndices.append(tIDs)
        
    # Cast touch indices to sets
    buckets = [set(l) for l in touchIndices]
    
    # Group touch indices based on intersections of their sets
    finished = False
    while not finished:
        finished = True
        for bA,bB in itertools.combinations(buckets,2):
            if bA.intersection(bB):
                finished = False
                if bA in buckets:
                    buckets.remove(bA)
                if bB in buckets:
                    buckets.remove(bB)
                buckets.append(bA.union(bB))
                break
                
    # Group edges based on bucket indices
    groupedEdges = []
    for b in buckets:
        c = [edges[i] for i in b]
        groupedEdges.append(c)
        
    return groupedEdges

def collapseShortEdges(edges,minEdgeLength,outerNodes,tol):
    
    """ Collase edges shorter than minEdgeLength """
    
    # Dispatch edges into edges to collapse and ones to keep
    shortEdges = []
    longEdges = []
    for e in edges:
        if e.Length > minEdgeLength or e.From in outerNodes:
            longEdges.append(e)
        else:
            shortEdges.append(e)
            
    # Group short edges by connectivity
    shortEdgesG= groupConnectedEdges(shortEdges,tol)
    
    # Get short edges vertices and average vertex
    shortEdgeVts = []
    centroids = []
    for g in shortEdgesG:
        vts = []
        for l in g:
            vts.extend((l.From,l.To))
        vts = list(set(vts))
        shortEdgeVts.append(vts)
        centroids.append(averagePoints(vts))
        
    # Adjust long edges to centroids if they touch short edges
    for vts,ct in zip(shortEdgeVts,centroids):
        for l in longEdges:
            if l.From in vts:
                l.From = ct
            elif l.To in vts:
                l.To = ct
                
    return longEdges

def pruneSortNetwork(lines,nested):
    
    """ Sorts a cable network by topological centrality. Most central
    cables is first in list, least central last """
    
    sortedNetwork = []
    while len(lines) > 0:
        
        # Get all line endpoints
        endPoints = []
        for l in lines:
            endPoints.append(l.From)
            endPoints.append(l.To)
            
            
        # Get indices of outer branch lines
        indices = []
        for i,l in enumerate(lines):
            startCount = endPoints.count(l.From)
            endCount = endPoints.count(l.To)
            if startCount == 1 or endCount == 1:
                indices.append(i)
                
        # Check that network has any outer branches
        if len(indices) > 0:
            
            # Sort the indices high to low
            indices.sort()
            indices.reverse()
            
            # Prune outer branches
            prunedBranches = [lines.pop(i) for i in indices]
            if nested:
                sortedNetwork.append(prunedBranches)
            else:
                sortedNetwork.extend(prunedBranches)
                
    # Reverse order and return list
    sortedNetwork.reverse()
    
    return sortedNetwork

if OuterNodes:
    
    # Remove duplicate points
    outernodes = list(rc.Geometry.Point3d.CullDuplicates(OuterNodes,OuterNodeTolerance))
    
    # Call methods
    pairs = makeProximityPairingNetwork(copy.copy(outernodes))
    edges = splitPairs(pairs,True)
    edges = relaxNetwork(edges,outernodes,RelaxIterations,0.00001,RelaxMode,densityForce)
    if MinEdgeLength:
        edges = collapseShortEdges(edges,MinEdgeLength,outernodes,0.0001)
    if PruneSort:
        edges = pruneSortNetwork(edges,False)
    
    # Output to GH
    Cables = edges
    EdgeSum = round(sum([l.Length for l in edges]),2)
    
else:
    
    Cables = []
    EdgeSume = []
# ---------- end gcn ----------
panel_2 = Panel(gcn.EdgeSum)
cables = Curve(gcn.Cables)

# ----
crv = Curve(cables)
explode = Explode(Curve=crv, Recursive=True)  # -> Segments, flatten(Vertices)
rdpoints = RemoveDuplicatePointsKaramba3D(Point=explode.Vertices, LimitDistance=0.005)  # -> OutPoint, Info, Indexes
pdecon = Deconstruct(Point=rdpoints.OutPoint)  # -> XComponent, YComponent, ZComponent
bnd = Bounds(Numbers=pdecon.ZComponent)
dom = ConstructDomain(DomainStart=Slider(0.132, range=0.02..0.2), DomainEnd=Slider(0.028, range=0.02..0.1))
remap = RemapNumbers(Value=pdecon.ZComponent, Source=bnd, Target=Domain(0, 1))  # -> Mapped, Clipped
remap_2 = RemapNumbers(Value=pdecon.ZComponent, Source=bnd, Target=dom)  # -> Mapped, Clipped
graph = GraphMapper(
    remap.Mapped,
    x0=0,
    x1=1,
    y0=0,
    y1=1,
    container_name="Bezier",
    cpx=[0, 0.8377102017, 0.3351024687, 1],
    cpy=[0, 0.2695206404, 0.8852167726, 1])
remap_3 = RemapNumbers(Value=graph, Source=Domain(0, 1), Target=dom)  # -> Mapped, Clipped
sph = Sphere(Base=rdpoints.OutPoint, Radius=remap_3.Mapped)
F = Fatten(Skeleton=crv, Spheres=sph, Thickness="0.07", LengthSubdivisions="3", EndType="0", AdjustForAngle=False)
F_2 = Fatten(Skeleton=crv, Spheres=sph, Thickness="0.07", LengthSubdivisions="2", EndType="0", AdjustForAngle=False)
medges = MeshEdges(Mesh=F)  # -> NakedEdges, InteriorEdges, NonManifoldEdges
dash = DashPattern(Curve=[medges.NakedEdges, medges.InteriorEdges], Pattern="0.03")  # -> Dashes, Gaps
crv_2 = Curve(dash.Dashes)
ndmaterial = NDMaterialAlpaca4d(MatName="S235", E=210000, V=0.3, Rho=78.5, Fy=23.5)
shell_section = ShellSectionAlpaca4d(SectionName="th", Thickness="0.05", NDMaterial=ndmaterial)
mesh_to_shell = MeshToShellAlpaca4d(Mesh=F, CrossSection=shell_section)

mesh_option_1 = Mesh(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)
deformed_1 = Mesh([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])
option_1 = Curve([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])

geo = Geometry([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])
geo_2 = Geometry(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)
geo_3 = Geometry([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])

# ----
# if you modify the screen
update = Button()

save_picture = BooleanToggle(True)
select_palette = Slider(6, range=0..6)
picture_name = Panel("test")

geo_4 = Geometry([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])
geo_5 = Geometry(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)
geo_6 = Geometry([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])

geo_7 = Geometry([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])
geo_8 = Geometry(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)
geo_9 = Geometry([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])

group = Group(Objects=geo_3)
group_2 = Group(Objects=option_1)
group_3 = Group(Objects=deformed_1)
group_4 = Group(Objects=geo_6)
mjoin = MeshJoin(Meshes=deformed_1)
mjoin_2 = MeshJoin(Meshes=geo)
mjoin_3 = MeshJoin(Meshes=geo_4)
mjoin_4 = MeshJoin(Meshes=geo_7)
group_5 = Group(Objects=geo_9)
merge_2 = Merge(Data1=group_2, Data2=group, Data3=group_4, Data4=group_5)
merge_3 = Merge(Data1=mesh_option_1, Data2=geo_2, Data3=geo_5, Data4=geo_8)
merge_4 = Merge(Data1=mjoin, Data2=mjoin_2, Data3=mjoin_3, Data4=mjoin_4)
entwine = Entwine(Branch00=merge_2, Branch01=merge_3, Branch02=merge_4, FlattenInputs=True)  # -> simplify(Result)
flip = FlipMatrix(Data=entwine)
range = Range(Domain=Slider(7.977, range=0..10), Steps="3")
range_2 = Range(Domain=Slider(6.954, range=0..10), Steps="2")
X = UnitX(Factor=range)
vec = VectorXYZ(XComponent=graft(range), YComponent=range_2, ZComponent=0)  # -> Vector, Length
graft = GraftTree(Tree=vec.Vector, IncludeEmptyLists=True, IncludeNullItems=True)
move_2 = Move(Geometry=flip, Motion=vec.Vector)  # -> Geometry, Transform
bbox = BoundingBox(Content=move_2.Geometry, Plane=PlaneXY(0, 0, 0))  # -> Box, Box_2
debrep = DeconstructBrep(Brep=bbox.Box)  # -> Faces, Edges, Vertices
item = ListItem(List=debrep.Faces, Index=0, Wrap=True)  # -> Item, Item1, Item2, Item3, Item4, Item5, Item6
rad = Radians(Degrees=Slider(0, range=0..720))
srf = Surface(item.Item4)
area = Area(Geometry=srf)  # -> Area, Centroid
shift = ShiftPaths(Data=area.Centroid, Offset=-1)
rotate = Rotate(Geometry=move_2.Geometry, Angle=rad, Plane=shift)  # -> Geometry, Transform
item_2 = ListItem(List=rotate.Geometry, Index=0, Wrap=True)  # -> Item, Item1, Item2
geo_10 = Geometry(item_2.Item)
mesh = Mesh(item_2.Item1)
geo_11 = Geometry(item_2.Item2)
medges_2 = MeshEdges(Mesh=mesh)  # -> NakedEdges, InteriorEdges, NonManifoldEdges
previewlw = CustomPreviewLineweights(Geometry=geo_10, Shader=ColourSwatch(SwatchColor=RGB(0, 0, 0)), Thickness=Slider(2, range=0..5), Absolute=False)
crv_3 = Curve(medges_2.NakedEdges)
crv_4 = Curve(medges_2.InteriorEdges)
previewlw_2 = CustomPreviewLineweights(Geometry=crv_3, Shader=ColourSwatch(SwatchColor=RGB(0, 0, 0)), Thickness="3", Absolute=False)
previewlw_3 = CustomPreviewLineweights(Geometry=crv_4, Shader=ColourSwatch(SwatchColor=RGB(0, 0, 0)), Thickness="1", Absolute=False)

wbnaked = WeaverbirdsNakedBoundary(MeshClosedPolylines=F)
curvepoint = PointOnCurve(wbnaked, parameter=0.5)
panel_3 = Panel("""2
4
6
4
3
3
6""")
pdecon_2 = Deconstruct(Point=curvepoint)  # -> XComponent, YComponent, ZComponent
swatch = ColourSwatch(SwatchColor=RGB(255, 255, 255))
swatch_2 = ColourSwatch(SwatchColor=RGB(0, 0, 0))
item_3 = ListItem(List=panel_3, Index=select_palette, Wrap=True)
sort = SortList(Keys=pdecon_2.ZComponent, ValuesA=wbnaked)  # -> Keys, ValuesA
merge_5 = Merge(Data1=swatch, Data2=swatch_2, Data3=swatch, Data4=swatch_2, Data5=swatch, Data6=swatch, Data7=swatch)
merge_6 = Merge(
    Data1=ColourSwatch(SwatchColor=RGB(0, 0, 0)),
    Data2=ColourSwatch(SwatchColor=RGB(148, 0, 181)),
    Data3=ColourSwatch(SwatchColor=RGB(255, 170, 0)),
    Data4=ColourSwatch(SwatchColor=RGB(194, 194, 14)),
    Data5=ColourSwatch(SwatchColor=RGB(34, 58, 212)),
    Data6=ColourSwatch(SwatchColor=RGB(48, 159, 255)),
    Data7=ColourSwatch(SwatchColor=RGB(191, 61, 61)))
split = SplitList(List=sort.ValuesA, Index="1")  # -> ListA, ListB
gradientlibrary = GradientLibrary(gradIndex=Slider(7, range=0..12))  # -> colors; inputs gradIndex: Int32
#   port colors: A series of colors to be plugged into the "Ladybug_Legend Parameters" component.
# ---------- gradientlibrary: Python ----------
"""
Preset of gradient colors perfect for Data Visualisation
    Inputs:
        gradIndex: An index refering to one of the following possible gradients:
            0 - Orignal Ladybug
            1 - Nuanced Ladybug
            2 - Multi-colored Ladybug
            3 - Ecotect
            4 - Thermal Comfort Percentage
            5 - Thermal Comfort Colors
            6 - Shade Benefit/Harm
            7 - Shade Harm
            8 - Shade Benefit
            9 - CFD Colors 1
            10 - Radiation Benefit
            11 - Gsa10 Colour
            12 - Gsa9 Colour
    Returns:
        customColors: A series of colors.
"""

ghenv.Component.Name = "Gradient Library"
ghenv.Component.NickName = 'GradientLibrary'
#ghenv.Component.Message = 'GradientLibrary\nWIP'

import scriptcontext as sc
import Grasshopper.Kernel as gh
import System

gradientLibrary = {
        0: [System.Drawing.Color.FromArgb(75, 107, 169), System.Drawing.Color.FromArgb(115, 147, 202), System.Drawing.Color.FromArgb(170, 200, 247), System.Drawing.Color.FromArgb(193, 213, 208), System.Drawing.Color.FromArgb(245, 239, 103), System.Drawing.Color.FromArgb(252, 230, 74), System.Drawing.Color.FromArgb(239, 156, 21), System.Drawing.Color.FromArgb(234, 123, 0), System.Drawing.Color.FromArgb(234, 74, 0), System.Drawing.Color.FromArgb(234, 38, 0)],
        1: [System.Drawing.Color.FromArgb(49,54,149), System.Drawing.Color.FromArgb(69,117,180), System.Drawing.Color.FromArgb(116,173,209), System.Drawing.Color.FromArgb(171,217,233), System.Drawing.Color.FromArgb(224,243,248), System.Drawing.Color.FromArgb(255,255,191), System.Drawing.Color.FromArgb(254,224,144), System.Drawing.Color.FromArgb(253,174,97), System.Drawing.Color.FromArgb(244,109,67), System.Drawing.Color.FromArgb(215,48,39), System.Drawing.Color.FromArgb(165,0,38)],
        2: [System.Drawing.Color.FromArgb(4,25,145), System.Drawing.Color.FromArgb(7,48,224), System.Drawing.Color.FromArgb(7,88,255), System.Drawing.Color.FromArgb(1,232,255), System.Drawing.Color.FromArgb(97,246,156), System.Drawing.Color.FromArgb(166,249,86), System.Drawing.Color.FromArgb(254,244,1), System.Drawing.Color.FromArgb(255,121,0), System.Drawing.Color.FromArgb(239,39,0), System.Drawing.Color.FromArgb(138,17,0)],
        3: [System.Drawing.Color.FromArgb(0,0,255), System.Drawing.Color.FromArgb(53,0,202), System.Drawing.Color.FromArgb(107,0,148), System.Drawing.Color.FromArgb(160,0,95), System.Drawing.Color.FromArgb(214,0,41), System.Drawing.Color.FromArgb(255,12,0), System.Drawing.Color.FromArgb(255,66,0), System.Drawing.Color.FromArgb(255,119,0), System.Drawing.Color.FromArgb(255,173,0), System.Drawing.Color.FromArgb(255,226,0), System.Drawing.Color.FromArgb(255,255,0)],
        4: [System.Drawing.Color.FromArgb(0,0,0), System.Drawing.Color.FromArgb(110,0,153), System.Drawing.Color.FromArgb(255,0,0), System.Drawing.Color.FromArgb(255,255,102), System.Drawing.Color.FromArgb(255,255,255)],
        5: [System.Drawing.Color.FromArgb(0,136,255), System.Drawing.Color.FromArgb(200,225,255), System.Drawing.Color.FromArgb(255,255,255), System.Drawing.Color.FromArgb(255,230,230), System.Drawing.Color.FromArgb(255,0,0)],
        6: [System.Drawing.Color.FromArgb(5,48,97), System.Drawing.Color.FromArgb(33,102,172), System.Drawing.Color.FromArgb(67,147,195), System.Drawing.Color.FromArgb(146,197,222), System.Drawing.Color.FromArgb(209,229,240), System.Drawing.Color.FromArgb(255,255,255), System.Drawing.Color.FromArgb(253,219,199), System.Drawing.Color.FromArgb(244,165,130), System.Drawing.Color.FromArgb(214,96,77), System.Drawing.Color.FromArgb(178,24,43), System.Drawing.Color.FromArgb(103,0,31)],
        7: [System.Drawing.Color.FromArgb(255,255,255), System.Drawing.Color.FromArgb(253,219,199), System.Drawing.Color.FromArgb(244,165,130), System.Drawing.Color.FromArgb(214,96,77), System.Drawing.Color.FromArgb(178,24,43), System.Drawing.Color.FromArgb(103,0,31)],
        8: [System.Drawing.Color.FromArgb(255,255,255), System.Drawing.Color.FromArgb(209,229,240), System.Drawing.Color.FromArgb(146,197,222), System.Drawing.Color.FromArgb(67,147,195), System.Drawing.Color.FromArgb(33,102,172), System.Drawing.Color.FromArgb(5,48,97)],
        9: [System.Drawing.Color.FromArgb(0,16,120), System.Drawing.Color.FromArgb(38,70,160), System.Drawing.Color.FromArgb(5,180,222), System.Drawing.Color.FromArgb(16,180,109), System.Drawing.Color.FromArgb(59,183,35), System.Drawing.Color.FromArgb(143,209,19), System.Drawing.Color.FromArgb(228,215,29), System.Drawing.Color.FromArgb(246,147,17), System.Drawing.Color.FromArgb(243,74,0), System.Drawing.Color.FromArgb(255,0,0)],
        10: [System.Drawing.Color.FromArgb(0,191,48), System.Drawing.Color.FromArgb(255,238,184), System.Drawing.Color.FromArgb(255,0,0)],
        11: [System.Drawing.Color.FromArgb(204,0,71), System.Drawing.Color.FromArgb(255,182,71), System.Drawing.Color.FromArgb(206,255,115), System.Drawing.Color.FromArgb(26,180, 214),System.Drawing.Color.FromArgb(0,0,207)],
        12: [System.Drawing.Color.FromArgb(255, 51, 51), System.Drawing.Color.FromArgb(255, 170, 51), System.Drawing.Color.FromArgb(255, 255, 51), System.Drawing.Color.FromArgb(170, 255, 125), System.Drawing.Color.FromArgb(51, 255, 231), System.Drawing.Color.FromArgb(51, 170, 255), System.Drawing.Color.FromArgb(51,51, 255)]}
colors = gradientLibrary[gradIndex]
# ---------- end gradientlibrary ----------
explode_2 = Explode(Curve=split.ListA, Recursive=True)  # -> Segments, Vertices
item_4 = ListItem(List=merge_6, Index=select_palette, Wrap=True)
rdpoints_2 = RemoveDuplicatePointsKaramba3D(Point=explode_2.Vertices, LimitDistance=0.005)  # -> OutPoint, Info, Indexes
explode_3 = Explode(Curve=split.ListB, Recursive=True)  # -> Segments, flatten(Vertices)
col = Colour(gradientlibrary)

# ----
# CHOOSE
# YOUR COLOUR
panel_4 = Panel("9")
range_3 = Range(Domain=Domain(0, 1), Steps=panel_4)
twnthrucols = TweenThroughColors(Colors=col, Factor=range_3, Normalized=True, Equalized=False, Weighted=False, Degree=3, InterpolationType=0, Alpha=True)

item_5 = ListItem(List=merge_5, Index=select_palette, Wrap=True)
python = GhPythonScript(color=item_4)  # -> out; inputs color: Color
# ---------- python: Python ----------
import Rhino.ApplicationSettings.AppearanceSettings
import System
import scriptcontext

settings = Rhino.ApplicationSettings.AppearanceSettings
settings.ViewportBackgroundColor = color

scriptcontext.doc.Views.Redraw()
# ---------- end python ----------
rdpoints_3 = RemoveDuplicatePointsKaramba3D(Point=explode_3.Vertices, LimitDistance=0.005)  # -> OutPoint, Info, Indexes
neg_2 = Negative(Value=Slider(0.2312, range=0..1))
toggle = BooleanToggle(True)
Z_2 = UnitZ(Factor=neg_2)
neg_3 = Negative(Value=Slider(5, range=1..10))
support = SupportAlpaca4d(Pos=rdpoints_2.OutPoint, Tx=toggle, Ty=toggle, Tz=toggle, Rx=toggle, Ry=toggle, Rz=toggle)
Z_3 = UnitZ(Factor=neg_3)
point_load = PointLoadAlpaca4d(Force=Z_3, Pos=rdpoints_3.OutPoint)  # -> flatten(LoadWrapper)
previewlw_4 = CustomPreviewLineweights(Geometry=crv_2, Shader=ColourSwatch(SwatchColor=RGB(199, 199, 199)), Absolute=False)
vdisex = VectorDisplayEx(Point=rdpoints_3.OutPoint, Vector=Z_2, Colour=ColourSwatch(SwatchColor=RGB(161, 0, 0)), Width=Slider(1.19, range=0.1..2))
viewports = ViewportProperties(Update=update, AutoUpdate=False)  # -> ViewportNames, ActiveViewportIndex, ViewportBounds, ViewportDisplayMode, CameraLocation, CameraTarget, CameraPlane, CameraLensLength, CameraProjection, CameraUp
item_6 = ListItem(List=viewports.ViewportBounds, Index=viewports.ActiveViewportIndex, Wrap=True)
drec = DeconstuctRectangle(Rectangle=item_6)  # -> BasePlane, XInterval, YInterval
number_slider = Slider(35, range=1..70)
int = Integer(expr("x/2", drec.XInterval))
int_2 = Integer(expr("x*0.85", drec.YInterval))

# ----
# Legend Panel
panel_5 = Panel("10")
rectangle = Rectangle(Plane=PlaneXY(0, 0, 0), XSize="0.5", YSize=panel_5, Radius=0)  # -> Rectangle, Length
rectangle_2 = Rectangle(Plane=PlaneXY(0, 0, 0), XSize=panel_5, YSize="0.5", Radius=0)  # -> Rectangle, Length
boundary = BoundarySurfaces(Edges=rectangle_2.Rectangle)
divide_2 = DivideDomain(Domain=boundary, UCount="1", VCount=10)
divide_3 = DivideDomain(Domain=boundary, UCount=10, VCount="1")
subsrf = Isotrim(Surface=boundary, Domain=divide_3)
explode_4 = MeshExplode(Mesh=subsrf, Interpolate=False)
mcol = MeshColours(Mesh=explode_4, Colours=graft(twnthrucols))  # -> flatten(Mesh)
mjoin_5 = MeshJoin(Meshes=mcol)
weldvertices = MeshWeldVertices(Mesh=mjoin_5, Tolerance=0.01)  # -> RuntimeMessage, Mesh
pt_2 = ConstructPoint(XCoordinate=int, YCoordinate=int_2, ZCoordinate=0)

multiplication = Multiplication(A=number_slider, B=panel_5)
division = Division(A=multiplication, B="2")
assemble_model = AssembleModelAlpaca4d(Element=mesh_to_shell, Support=flatten(support), Load=point_load)  # -> AlpacaModel, MassOfStructure
X_2 = UnitX(Factor=division)
rev = Reverse(Vector=X_2)
move_3 = Move(Geometry=pt_2, Motion=rev)  # -> Geometry, Transform
static_analyses = StaticAnalysesAlpaca4d(AlpacaModel=assemble_model.AlpacaModel)
number_slider_2 = Slider(16, range=1..50)
mesh_2 = Mesh(F)
multiplication_2 = Multiplication(A=number_slider, B=panel_5)
random = Random(Range="0 to 17", Number="200", Seed=2)
number_slider_3 = Slider(0.0052, range=0..1)
medges_3 = MeshEdges(Mesh=mesh_2)  # -> NakedEdges, InteriorEdges, NonManifoldEdges
multiplication_3 = Multiplication(A="0.5", B=number_slider)
X_3 = UnitX(Factor=multiplication_2)
gradientlibrary_2 = GradientLibraryAlpaca4d(GradientIndex=Slider(0, range=0..12))
multiplication_4 = Multiplication(A=number_slider_2, B=0.5)
panel_6 = Panel("3")  # disabled
num = Number(expr("Round(x,0)", random))
move_4 = Move(Geometry=move_3.Geometry, Motion=X_3)  # -> Geometry, Transform
addition = Addition(A=multiplication_3, B=multiplication_4)
bnd_2 = Bounds(Numbers=num)
modal_analyses = ModalAnalysesAlpaca4d(AlpacaModel=assemble_model.AlpacaModel, NumVibrationModes=panel_6)  # -> AlpacaModalOutput, Frequency, Period; disabled
merge_7 = Merge(Data1=move_3.Geometry, Data2=move_4.Geometry)
mcol_2 = MeshColours(Mesh=mesh, Colours=ColourSwatch(SwatchColor=RGB(255, 255, 255)))
static_model_view = StaticModelViewAlpaca4d(AlpacaStaticOutput=static_analyses, ColorList=gradientlibrary)  # -> ModelDisp, DisplacementRange
crv_5 = Curve(medges_3.NakedEdges)
vec_2 = VectorXYZ(XComponent=0, YComponent=addition, ZComponent=0)  # -> Vector, Length
crv_6 = Curve(medges_3.InteriorEdges)
dedomain = DeconstructDomain(Domain=bnd_2)  # -> Start, End
number_slider_4 = Slider(1, range=1..3)  # disabled
number_slider_5 = Slider(1.2893, range=0.0001..5)  # disabled
merge_8 = Merge(Data1=dedomain.Start, Data2=dedomain.End)
custom_preview = CustomPreview(Geometry=mesh_2, Material=ColourSwatch(SwatchColor=RGB(255, 255, 255)))
number_slider_6 = Slider(1, range=1..1000)  # disabled
button = Button()  # disabled
move_5 = Move(Geometry=merge_7, Motion=vec_2.Vector)  # -> Geometry, Transform
previewlw_5 = CustomPreviewLineweights(Geometry=crv_5, Shader=ColourSwatch(SwatchColor=RGB(0, 0, 0)), Thickness="3", Absolute=False)
previewlw_6 = CustomPreviewLineweights(Geometry=crv_6, Shader=ColourSwatch(SwatchColor=RGB(0, 0, 0)), Thickness="1", Absolute=False)
toggle_2 = BooleanToggle(False)  # disabled
toggle_3 = BooleanToggle(True)  # disabled
mesh_3 = Mesh(static_model_view.ModelDisp)
int_3 = Integer(drec.YInterval)
int_4 = Integer(drec.XInterval)
visualisemodel = VisualiseModelAlpaca4d()  # -> AlpacaModel, Model
modal_model_view = ModalModelViewAlpaca4d(
    AlpacaModalOutput=modal_analyses.AlpacaModalOutput,
    NumberMode=number_slider_4,
    Speed=number_slider_5,
    Animate=toggle_2,
    Reset=button,
    ModelExtrude=toggle_3)  # disabled
meshtoscreen = RenderMeshToScreen(Mesh=weldvertices.Mesh, Location=move_3.Geometry, ScaleFactor=number_slider, Depth=0.95, Fixed=True, m_scWithvp=False)
texttoscreen = RenderTextToScreen(Text=merge_8, Location=move_5.Geometry, Size=number_slider_2, Color=item_5, Font="Iosevka", m_scWithvp=False)
captureview = Ladybug_CaptureView(fileName=picture_name, imageWidth=int_4, imageHeight=int_3, capture=save_picture)  # -> Output; plug-in component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
mesh_4 = Mesh(modal_model_view)  # disabled
panel_7 = Panel(captureview)
num_2 = Number("672")
num_3 = Number("10.5")
num_4 = Number("460")
python_2 = GhPythonScript(imagePath=captureview)  # -> out, a
# ---------- python_2: Python ----------
import System


fileName =r'C:\Dev\WorkWithImage\cutImage.py'
pythonInterpreter = 'python.exe'

wrapperFile = '"' + imagePath + '"'
fileName = '"' + fileName + '"'

p = System.Diagnostics.Process()
p.StartInfo.RedirectStandardOutput = True
p.StartInfo.RedirectStandardError = True

p.StartInfo.UseShellExecute = False
p.StartInfo.CreateNoWindow = True

p.StartInfo.FileName = pythonInterpreter
p.StartInfo.Arguments = fileName + " " + wrapperFile + " " 
p.Start()
p.WaitForExit()

a = p.StandardOutput.ReadLine()
# ---------- end python_2 ----------
panel_8 = Panel(python_2.a)

panel_9 = Panel("""Shell Analyses
Shell Elements: 
Total Length: 
Computation Time: """)
entwine_2 = Entwine(Branch00=" ", Branch01=num_2, Branch02=num_3, Branch03=num_4, FlattenInputs=True)  # -> flatten(Result)
panel_10 = Panel(""" 
 
 m
 ms""")
concat = Concatenate(FragmentA=panel_9, FragmentB=entwine_2, FragmentC=panel_10)
panel_11 = Panel(concat)
number_slider_7 = Slider(12, range=1..100)
lng = ListLength(List=concat)
series = Series(Start=Slider(73, range=1..100), Step=expr("x*2", number_slider_7), Count=lng)
pt_3 = ConstructPoint(XCoordinate=Slider(42, range=1..100), YCoordinate=series, ZCoordinate=0)
texttoscreen_2 = RenderTextToScreen(
    Text=concat,
    Location=pt_3,
    Size=number_slider_7,
    Color=ColourSwatch(SwatchColor=RGB(255, 255, 255)),
    Font="Inconsolata",
    m_scWithvp=False)
