# Grasshopper definition Alpaca4d_rhinoVault.gh (Grasshopper 1.0.7)
# plug-ins: MeshEdit Components, Pufferfish, Human, Alpaca4d

mesh = Mesh([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])

# ----
# if you modify the screen
update = Button()

save_picture = BooleanToggle(False)
select_palette = Slider(1, range=0..6)
mjoin = MeshJoin(Meshes=mesh)
picture_name = Panel("test")
uniaxialmaterial = UniaxialMaterialAlpaca4d(MatName="S235", E=210000, V=0.3, Rho=78.5, Fy=23.5)
weldvertices = MeshWeldVertices(Mesh=mjoin, Tolerance=0.01)  # -> RuntimeMessage, Mesh
circular_cross_section = CircularCrossSectionAlpaca4d(SectionName="CHS20", Diameter="200", Thickness="1", UniaxialMaterial=uniaxialmaterial)
demesh = DeconstructMesh(Mesh=weldvertices.Mesh)  # -> Vertices, Faces, Colours, Normals
medges = MeshEdges(Mesh=weldvertices.Mesh)  # -> NakedEdges, InteriorEdges, NonManifoldEdges
pdecon = Deconstruct(Point=demesh.Vertices)  # -> XComponent, YComponent, ZComponent
crv = Curve([medges.NakedEdges, medges.InteriorEdges, medges.NonManifoldEdges])
smaller = SmallerThan(FirstNumber=pdecon.ZComponent, SecondNumber=0.001)  # -> SmallerThan, OrEqualTo
line_to_beam = LineToBeamAlpaca4d(Line=crv, Colour=ColourSwatch(SwatchColor=RGB(255, 255, 255)), CrossSection=circular_cross_section)
dispatch = Dispatch(List=demesh.Vertices, DispatchPattern=smaller.SmallerThan)  # -> ListA, ListB
neg = Negative(Value=Slider(5, range=0..10))
toggle = BooleanToggle(True)
Z = UnitZ(Factor=neg)
toggle_2 = BooleanToggle(False)
panel = Panel("""2
4
6
4
3
3
6""")
point_load = PointLoadAlpaca4d(Force=Z, Pos=dispatch.ListB)
swatch = ColourSwatch(SwatchColor=RGB(255, 255, 255))
support = SupportAlpaca4d(Pos=dispatch.ListA, Tx=toggle, Ty=toggle, Tz=toggle, Rx=toggle_2, Ry=toggle_2, Rz=toggle_2)
swatch_2 = ColourSwatch(SwatchColor=RGB(0, 0, 0))
item = ListItem(List=panel, Index=select_palette, Wrap=True)
merge = Merge(Data1=swatch, Data2=swatch_2, Data3=swatch, Data4=swatch_2, Data5=swatch, Data6=swatch, Data7=swatch)
merge_2 = Merge(
    Data1=ColourSwatch(SwatchColor=RGB(0, 0, 0)),
    Data2=ColourSwatch(SwatchColor=RGB(148, 0, 181)),
    Data3=ColourSwatch(SwatchColor=RGB(255, 170, 0)),
    Data4=ColourSwatch(SwatchColor=RGB(194, 194, 14)),
    Data5=ColourSwatch(SwatchColor=RGB(34, 58, 212)),
    Data6=ColourSwatch(SwatchColor=RGB(48, 159, 255)),
    Data7=ColourSwatch(SwatchColor=RGB(237, 12, 42)))
gradientlibrary = GradientLibrary(gradIndex=Slider(7, range=0..12))  # -> colors; inputs gradIndex: Int32
#   port colors: A series of colors to be plugged into the "Ladybug_Legend Parameters" component.
# ---------- gradientlibrary: Python ----------
"""
Preset of gradient colors perfect for Data Visualisation
    Inputs:
        gradIndex: An index refering to one of the following possible gradients:
            0 - Orignal Ladybug
            1 - Nuanced Ladybug
            2 - Multi-colored Ladybug
            3 - Ecotect
            4 - Thermal Comfort Percentage
            5 - Thermal Comfort Colors
            6 - Shade Benefit/Harm
            7 - Shade Harm
            8 - Shade Benefit
            9 - CFD Colors 1
            10 - Radiation Benefit
            11 - Gsa10 Colour
            12 - Gsa9 Colour
    Returns:
        customColors: A series of colors.
"""

ghenv.Component.Name = "Gradient Library"
ghenv.Component.NickName = 'GradientLibrary'
#ghenv.Component.Message = 'GradientLibrary\nWIP'

import scriptcontext as sc
import Grasshopper.Kernel as gh
import System

gradientLibrary = {
        0: [System.Drawing.Color.FromArgb(75, 107, 169), System.Drawing.Color.FromArgb(115, 147, 202), System.Drawing.Color.FromArgb(170, 200, 247), System.Drawing.Color.FromArgb(193, 213, 208), System.Drawing.Color.FromArgb(245, 239, 103), System.Drawing.Color.FromArgb(252, 230, 74), System.Drawing.Color.FromArgb(239, 156, 21), System.Drawing.Color.FromArgb(234, 123, 0), System.Drawing.Color.FromArgb(234, 74, 0), System.Drawing.Color.FromArgb(234, 38, 0)],
        1: [System.Drawing.Color.FromArgb(49,54,149), System.Drawing.Color.FromArgb(69,117,180), System.Drawing.Color.FromArgb(116,173,209), System.Drawing.Color.FromArgb(171,217,233), System.Drawing.Color.FromArgb(224,243,248), System.Drawing.Color.FromArgb(255,255,191), System.Drawing.Color.FromArgb(254,224,144), System.Drawing.Color.FromArgb(253,174,97), System.Drawing.Color.FromArgb(244,109,67), System.Drawing.Color.FromArgb(215,48,39), System.Drawing.Color.FromArgb(165,0,38)],
        2: [System.Drawing.Color.FromArgb(4,25,145), System.Drawing.Color.FromArgb(7,48,224), System.Drawing.Color.FromArgb(7,88,255), System.Drawing.Color.FromArgb(1,232,255), System.Drawing.Color.FromArgb(97,246,156), System.Drawing.Color.FromArgb(166,249,86), System.Drawing.Color.FromArgb(254,244,1), System.Drawing.Color.FromArgb(255,121,0), System.Drawing.Color.FromArgb(239,39,0), System.Drawing.Color.FromArgb(138,17,0)],
        3: [System.Drawing.Color.FromArgb(0,0,255), System.Drawing.Color.FromArgb(53,0,202), System.Drawing.Color.FromArgb(107,0,148), System.Drawing.Color.FromArgb(160,0,95), System.Drawing.Color.FromArgb(214,0,41), System.Drawing.Color.FromArgb(255,12,0), System.Drawing.Color.FromArgb(255,66,0), System.Drawing.Color.FromArgb(255,119,0), System.Drawing.Color.FromArgb(255,173,0), System.Drawing.Color.FromArgb(255,226,0), System.Drawing.Color.FromArgb(255,255,0)],
        4: [System.Drawing.Color.FromArgb(0,0,0), System.Drawing.Color.FromArgb(110,0,153), System.Drawing.Color.FromArgb(255,0,0), System.Drawing.Color.FromArgb(255,255,102), System.Drawing.Color.FromArgb(255,255,255)],
        5: [System.Drawing.Color.FromArgb(0,136,255), System.Drawing.Color.FromArgb(200,225,255), System.Drawing.Color.FromArgb(255,255,255), System.Drawing.Color.FromArgb(255,230,230), System.Drawing.Color.FromArgb(255,0,0)],
        6: [System.Drawing.Color.FromArgb(5,48,97), System.Drawing.Color.FromArgb(33,102,172), System.Drawing.Color.FromArgb(67,147,195), System.Drawing.Color.FromArgb(146,197,222), System.Drawing.Color.FromArgb(209,229,240), System.Drawing.Color.FromArgb(255,255,255), System.Drawing.Color.FromArgb(253,219,199), System.Drawing.Color.FromArgb(244,165,130), System.Drawing.Color.FromArgb(214,96,77), System.Drawing.Color.FromArgb(178,24,43), System.Drawing.Color.FromArgb(103,0,31)],
        7: [System.Drawing.Color.FromArgb(255,255,255), System.Drawing.Color.FromArgb(253,219,199), System.Drawing.Color.FromArgb(244,165,130), System.Drawing.Color.FromArgb(214,96,77), System.Drawing.Color.FromArgb(178,24,43), System.Drawing.Color.FromArgb(103,0,31)],
        8: [System.Drawing.Color.FromArgb(255,255,255), System.Drawing.Color.FromArgb(209,229,240), System.Drawing.Color.FromArgb(146,197,222), System.Drawing.Color.FromArgb(67,147,195), System.Drawing.Color.FromArgb(33,102,172), System.Drawing.Color.FromArgb(5,48,97)],
        9: [System.Drawing.Color.FromArgb(0,16,120), System.Drawing.Color.FromArgb(38,70,160), System.Drawing.Color.FromArgb(5,180,222), System.Drawing.Color.FromArgb(16,180,109), System.Drawing.Color.FromArgb(59,183,35), System.Drawing.Color.FromArgb(143,209,19), System.Drawing.Color.FromArgb(228,215,29), System.Drawing.Color.FromArgb(246,147,17), System.Drawing.Color.FromArgb(243,74,0), System.Drawing.Color.FromArgb(255,0,0)],
        10: [System.Drawing.Color.FromArgb(0,191,48), System.Drawing.Color.FromArgb(255,238,184), System.Drawing.Color.FromArgb(255,0,0)],
        11: [System.Drawing.Color.FromArgb(204,0,71), System.Drawing.Color.FromArgb(255,182,71), System.Drawing.Color.FromArgb(206,255,115), System.Drawing.Color.FromArgb(26,180, 214),System.Drawing.Color.FromArgb(0,0,207)],
        12: [System.Drawing.Color.FromArgb(255, 51, 51), System.Drawing.Color.FromArgb(255, 170, 51), System.Drawing.Color.FromArgb(255, 255, 51), System.Drawing.Color.FromArgb(170, 255, 125), System.Drawing.Color.FromArgb(51, 255, 231), System.Drawing.Color.FromArgb(51, 170, 255), System.Drawing.Color.FromArgb(51,51, 255)]}
colors = gradientLibrary[gradIndex]
# ---------- end gradientlibrary ----------
assemble_model = AssembleModelAlpaca4d(Element=flatten(line_to_beam), Support=flatten(support), Load=flatten(point_load))  # -> AlpacaModel, MassOfStructure
item_2 = ListItem(List=merge_2, Index=select_palette, Wrap=True)
col = Colour(gradientlibrary)

# ----
# CHOOSE
# YOUR COLOUR
panel_2 = Panel("9")
range = Range(Domain=Domain(0, 1), Steps=panel_2)
twnthrucols = TweenThroughColors(Colors=col, Factor=range, Normalized=True, Equalized=False, Weighted=False, Degree=3, InterpolationType=0, Alpha=True)

item_3 = ListItem(List=merge, Index=select_palette, Wrap=True)
python = GhPythonScript(color=item_2)  # -> out; inputs color: Color
# ---------- python: Python ----------
import Rhino.ApplicationSettings.AppearanceSettings
import System
import scriptcontext

settings = Rhino.ApplicationSettings.AppearanceSettings
settings.ViewportBackgroundColor = color

scriptcontext.doc.Views.Redraw()
# ---------- end python ----------
static_analyses = StaticAnalysesAlpaca4d(AlpacaModel=assemble_model.AlpacaModel)
viewports = ViewportProperties(Update=update, AutoUpdate=False)  # -> ViewportNames, ActiveViewportIndex, ViewportBounds, ViewportDisplayMode, CameraLocation, CameraTarget, CameraPlane, CameraLensLength, CameraProjection, CameraUp
static_model_view = StaticModelViewAlpaca4d(AlpacaStaticOutput=static_analyses, ColorList=gradientlibrary)  # -> ModelDisp, DisplacementRange
visualisemodel = VisualiseModelAlpaca4d(AlpacaModel=assemble_model.AlpacaModel)  # -> AlpacaModel, Model
item_4 = ListItem(List=viewports.ViewportBounds, Index=viewports.ActiveViewportIndex, Wrap=True)
beamforces = BeamForcesAlpaca4d(AlpacaStaticOutput=static_analyses)  # -> TagElement, N, V1, V2, Mt, M1, M2
drec = DeconstuctRectangle(Rectangle=item_4)  # -> BasePlane, XInterval, YInterval
mesh_2 = Mesh(visualisemodel.Model)
number_slider = Slider(35, range=1..70)
int = Integer(expr("x/2", drec.XInterval))
int_2 = Integer(expr("x*0.85", drec.YInterval))
number_slider_2 = Slider(16, range=1..50)
random = Random(Range="0 to 20", Number="200", Seed=2)
multiplication = Multiplication(A=number_slider_2, B=0.5)
num = Number(expr("Round(x,0)", random))
bnd = Bounds(Numbers=num)
dedomain = DeconstructDomain(Domain=bnd)  # -> Start, End
merge_3 = Merge(Data1=dedomain.Start, Data2=dedomain.End)
int_3 = Integer(drec.YInterval)
int_4 = Integer(drec.XInterval)
captureview = Ladybug_CaptureView(fileName=picture_name, imageWidth=int_4, imageHeight=int_3, capture=save_picture)  # -> Output; plug-in component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
panel_3 = Panel(captureview)
python_2 = GhPythonScript(imagePath=captureview)  # -> out, a
# ---------- python_2: Python ----------
import System


fileName =r'C:\Dev\WorkWithImage\cutImage.py'
pythonInterpreter = 'python.exe'

wrapperFile = '"' + imagePath + '"'
fileName = '"' + fileName + '"'

p = System.Diagnostics.Process()
p.StartInfo.RedirectStandardOutput = True
p.StartInfo.RedirectStandardError = True

p.StartInfo.UseShellExecute = False
p.StartInfo.CreateNoWindow = True

p.StartInfo.FileName = pythonInterpreter
p.StartInfo.Arguments = fileName + " " + wrapperFile + " " 
p.Start()
p.WaitForExit()

a = p.StandardOutput.ReadLine()
# ---------- end python_2 ----------
panel_4 = Panel(python_2.a)

# ----
# Legend Panel
panel_5 = Panel("10")
rectangle = Rectangle(Plane=PlaneXY(0, 0, 0), XSize="0.5", YSize=panel_5, Radius=0)  # -> Rectangle, Length
rectangle_2 = Rectangle(Plane=PlaneXY(0, 0, 0), XSize=panel_5, YSize="0.5", Radius=0)  # -> Rectangle, Length
boundary = BoundarySurfaces(Edges=rectangle_2.Rectangle)
divide = DivideDomain(Domain=boundary, UCount="1", VCount=10)
divide_2 = DivideDomain(Domain=boundary, UCount=10, VCount="1")
subsrf = Isotrim(Surface=boundary, Domain=divide_2)
explode = MeshExplode(Mesh=subsrf, Interpolate=False)
mcol = MeshColours(Mesh=explode, Colours=graft(twnthrucols))  # -> flatten(Mesh)
mjoin_2 = MeshJoin(Meshes=mcol)
weldvertices_2 = MeshWeldVertices(Mesh=mjoin_2, Tolerance=0.01)  # -> RuntimeMessage, Mesh
pt = ConstructPoint(XCoordinate=int, YCoordinate=int_2, ZCoordinate=0)

multiplication_2 = Multiplication(A=number_slider, B=panel_5)
division = Division(A=multiplication_2, B="2")
X = UnitX(Factor=division)
rev = Reverse(Vector=X)
move = Move(Geometry=pt, Motion=rev)  # -> Geometry, Transform

meshtoscreen = RenderMeshToScreen(Mesh=weldvertices_2.Mesh, Location=move.Geometry, ScaleFactor=number_slider, Depth=0.95, Fixed=True, m_scWithvp=False)

multiplication_3 = Multiplication(A=number_slider, B=panel_5)
multiplication_4 = Multiplication(A="0.5", B=number_slider)
X_2 = UnitX(Factor=multiplication_3)
move_2 = Move(Geometry=move.Geometry, Motion=X_2)  # -> Geometry, Transform
addition = Addition(A=multiplication_4, B=multiplication)
merge_4 = Merge(Data1=move.Geometry, Data2=move_2.Geometry)
vec = VectorXYZ(XComponent=0, YComponent=addition, ZComponent=0)  # -> Vector, Length
move_3 = Move(Geometry=merge_4, Motion=vec.Vector)  # -> Geometry, Transform
texttoscreen = RenderTextToScreen(Text=merge_3, Location=move_3.Geometry, Size=number_slider_2, Color=item_3, Font="Iosevka", m_scWithvp=False)
