# Grasshopper definition crapperShellTest2_RhinoVault.gh (Grasshopper 1.0.7)
# plug-ins: K2Engineering, Human, Kangaroo Components, Weaverbird, Kangaroo2 Components, plankton, ggRhinoIFC, karambaGH

dpipeline = DynamicGeometryPipeline(
    LayerFilter="Springs",
    TypeFilter="Curve",
    NameFilter="*",
    GroupByLayer=False,
    GroupByType=False,
    IncludeHidden=True,
    IncludeLocked=True,
    enableFullPath=False,
    listenToAttributes=True)
crv = Curve(reparameterize(dpipeline))
# Format Engineers CAD Information Issue Disclaimer
# 
# Project: PROJECT NAME
# 
# You should use this model for reference purposes only to assist in co-ordinating your work and is supplementary to formally issued drawings. Once the data is introduced into your own CAD or other system Format Engineers Ltd. can take no responsibility for its accuracy.
# 
# The last set of formally issued paper drawings are the contractual documents which represent the current stage of design development. If you have any queries, please contact the project CAD co-ordinator or the CAD Development Team.
# 
# Changes:
# 
# YYYY-MM-DD: Summary of changes
# 
# Usage notes:
# 
# This definition includes a basic implementation of Merbarki's Farthest Point Seeding algorithm (2005), adapted for tracing lines of principal curvature on NURBS surfaces. Requires modified Triangle.NET, if this isn't attached then... good luck! There are currently two main limitations: (a) this implementation measures density in parameter space, and (b) it doesn't include the dynamic refinement of density that Mebarki suggests.
gggrasshoppersettings = GgGrasshopperSettings(
    SettingsData_IFCSettings_Format="STEP",
    SettingsData_IFCSettings_GenerateOwnerHistory=True,
    SettingsData_IFCSettings_IdentifyObsolete=True,
    SettingsData_IFCSettings_LastUsedUnits="Meters",
    SettingsData_IFCSettings_Radians=True,
    SettingsData_IFCSettings_RepMapExport="NONE",
    SettingsData_IFCSettings_Target="Universal",
    SettingsData_IFCSettings_VersionIFC="IFC2x3",
    SettingsData_RevitSettings_Format="STEP",
    SettingsData_RevitSettings_GenerateOwnerHistory=True,
    SettingsData_RevitSettings_IdentifyObsolete=True,
    SettingsData_RevitSettings_LastUsedUnits="Meters",
    SettingsData_RevitSettings_Radians=True,
    SettingsData_RevitSettings_RepMapExport="NONE",
    SettingsData_RevitSettings_Target="Universal",
    SettingsData_RevitSettings_VersionIFC="IFC4")
graft = GraftTree(Tree=crv, IncludeEmptyLists=True, IncludeNullItems=True)  # -> simplify(Tree)
crv_2 = Curve([<curve referenced from the Rhino model> x66])
panel = Panel("6")
wbweave = WeaverbirdsMeshFromLinesWeaveBack(Lines=crv_2, MaximumValence=4)
clean = CombineClean(Meshes=wbweave)
objatts = ObjectAttributes(ObjectOrAttributes=dpipeline)  # -> Name, LayerName, LayerFullPath, Color, MaterialName, LinetypeName, GroupIndices, PlotWeight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
crv_3 = Curve([<curve referenced from the Rhino model> x560])
unim = UnifyMesh(Mesh=clean)  # -> Result, Count
wbunify = WeaverbirdsUnifyFaceWindings(MeshCurves=unim.Result)
crv_4 = Curve([<curve referenced from the Rhino model> x524])
refine = Refine(Mesh=wbunify, Level="2")
tri = Triangulate(Mesh=refine)  # -> Mesh, Count
demesh = DeconstructMesh(Mesh=tri.Mesh)  # -> Vertices, Faces, Colours, Normals
crv_cp = CurveClosestPoint(Point=demesh.Vertices, Curve=graft(crv))  # -> Point, Parameter, Distance
smaller = SmallerThan(FirstNumber=crv_cp.Distance, SecondNumber="0.01")  # -> SmallerThan, OrEqualTo
cull = CullPattern(List=crv_cp.Parameter, CullPattern=smaller.SmallerThan)
sort = SortList(Keys=cull)  # -> Keys, ValuesA
shatter = Shatter(Curve=simplify(graft), Parameters=simplify(sort.Keys))
end = EndPoints(Curve=shatter)  # -> Start, End
ln = Line(StartPoint=end.Start, EndPoint=end.End)
clean_2 = CleanTree(RemoveNulls=invert(True), RemoveInvalid=True, RemoveEmpty=False, Tree=ln)
medges = MeshEdges(Mesh=tri.Mesh)  # -> NakedEdges, InteriorEdges, NonManifoldEdges
curvepoint = PointOnCurve(clean_2, parameter=0.5)
crv_5 = Curve(medges.InteriorEdges)
curvepoint_2 = PointOnCurve(crv_5, parameter=0.5)
dpipeline_2 = DynamicGeometryPipeline(
    LayerFilter="Boundary",
    TypeFilter="Curve",
    NameFilter="*",
    GroupByLayer=False,
    GroupByType=False,
    IncludeHidden=True,
    IncludeLocked=True,
    enableFullPath=False,
    listenToAttributes=True)
demesh_2 = DeconstructMesh(Mesh=tri.Mesh)  # -> Vertices, Faces, Colours, Normals
fsim = FindSimilarMember(Data=flatten(curvepoint), Set=flatten(curvepoint_2))  # -> Hit, Index
wbweave_2 = WeaverbirdsMeshFromLinesWeaveBack(Lines=crv_4, MaximumValence=4)
number_slider = Slider(6.052, range=0..10)
strength = Data(objatts.Name)
cull_i = CullIndex(List=crv_5, Indices=fsim.Index, Wrap=True)
tri_2 = Triangulate(Mesh=tri.Mesh)  # -> Mesh, Count
crv_cp_2 = CurveClosestPoint(Point=demesh_2.Vertices, Curve=graft(dpipeline_2))  # -> Point, Parameter, Distance
tri_3 = Triangulate(Mesh=wbweave_2)  # -> Mesh, Count
pt = Point([<point referenced from the Rhino model> x42])
graft_2 = GraftTree(Tree=strength, IncludeEmptyLists=True, IncludeNullItems=True)
pmesh = PlanktonMesh(tri_3.Mesh)
pmesh_2 = PlanktonMesh(tri_2.Mesh)
anchor = Anchor(Point=pt, Strength=10000)
smaller_2 = SmallerThan(FirstNumber=crv_cp_2.Distance, SecondNumber="0.01")  # -> SmallerThan, OrEqualTo
length_line = LengthLine(Line=crv_3, Length="0", Strength=Slider(16.884, range=0..20))
mvarea = MeshVertexArea(PlanktonMesh=pmesh)  # -> Vertices, VertexNormals
mvarea_2 = MeshVertexArea(PlanktonMesh=pmesh_2)  # -> Vertices, VertexNormals
length_line_2 = LengthLine(Line=clean_2, Length="0", Strength=graft_2)
length_line_3 = LengthLine(Line=cull_i, Length="0", Strength=Slider(1, range=0.01..4))
show = Show(G=crv_3)
cull_2 = CullPattern(List=demesh_2.Vertices, CullPattern=smaller_2.SmallerThan)
neg = Negative(Value=Slider(5.8168, range=0..10))
show_2 = Show(G=tri.Mesh)
rdpoints = RemoveDuplicatePointsKaramba3D(Point=flatten(cull_2), LimitDistance=0.005)  # -> OutPoint, Info, Indexes
multiplication = Multiplication(A=mvarea.VertexNormals, B=neg)
mselfweight = MeshSelfweight(VertexNormals=mvarea_2.VertexNormals, Thickness=Slider(21, range=0..200), MaterialDensity="1")
rev = Reverse(Vector=mselfweight)
load = Load(Point=mvarea.Vertices, NodalForce=multiplication)
entwine = Entwine(Branch00=show, Branch01=length_line, Branch02=anchor, Branch03=load, FlattenInputs=True)
anchor_2 = Anchor(Point=rdpoints.OutPoint, Strength=10000)
load_2 = Load(Point=mvarea_2.Vertices, NodalForce=rev)
solver = Solver(GoalObjects=entwine, Reset=Button(), Threshold=1e-15, Tolerance=0.01, On=Toggle(True))  # -> I, V, O
crv_6 = Curve(solver.O)
entwine_2 = Entwine(Branch00=show_2, Branch01=[length_line_3, length_line_2], Branch02=anchor_2, Branch03=load_2, FlattenInputs=True)
wbweave_3 = WeaverbirdsMeshFromLinesWeaveBack(Lines=crv_3, MaximumValence=4)
bang = ExplodeTree(Data=crv_6)  # -> Branch0, Branch1
solver_2 = Solver(GoalObjects=entwine_2, Reset=Button(), Threshold=1e-15, Tolerance=0.01, On=Toggle(True))  # -> I, V, O
clean_3 = CleanTree(RemoveNulls=True, RemoveInvalid=True, RemoveEmpty=False, Tree=flatten(bang.Branch0))  # -> flatten(Tree)
bang_2 = ExplodeTree(Data=solver_2.O)  # -> Branch0, Branch1
wbweave_4 = WeaverbirdsMeshFromLinesWeaveBack(Lines=clean_3, MaximumValence=4)
mesh = Mesh(bang_2.Branch0)
clean_4 = CombineClean(Meshes=wbweave_4)
mesh_2 = Mesh(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)
mesh_3 = Mesh(mesh)
medges_2 = MeshEdges(Mesh=mesh_3)  # -> NakedEdges, InteriorEdges, NonManifoldEdges
crv_7 = Curve(medges_2.NakedEdges)
crv_8 = Curve(medges_2.InteriorEdges)
custom_preview = CustomPreview(Geometry=mesh_3, Material=ColourSwatch(SwatchColor=RGB(255, 255, 255)))
previewlw = CustomPreviewLineweights(Geometry=crv_7, Shader=ColourSwatch(SwatchColor=RGB(0, 0, 0)), Thickness="3", Absolute=False)
previewlw_2 = CustomPreviewLineweights(Geometry=crv_8, Shader=ColourSwatch(SwatchColor=RGB(0, 0, 0)), Thickness="1", Absolute=False)
