# Grasshopper definition shellVault.gh (Grasshopper 1.0.7)
# plug-ins: MeshEdit Components, Pufferfish, Human, Alpaca4d, Weaverbird, Kangaroo2 Components

mesh = Mesh([<mesh referenced from the Rhino model> x34])
mjoin = MeshJoin(Meshes=mesh)
clean = CombineClean(Meshes=mjoin)
wbsplitquads = WeaverbirdsConstantQuadsSplitSubdivision(MeshCurves=clean, Level=Slider(2, range=1..3), SmoothNakedEdges=1)
unifynormals = MeshUnifyNormals(Mesh=wbsplitquads)
msmooth = SmoothMesh(Mesh=unifynormals, Strength=Slider(1, range=0..1), SkipNaked=True, Iterations=1)
show = Show(G=unifynormals)
nv = NakedVertices(Mesh=unifynormals)  # -> ClothedIndex, NakedIndex, ClothedPts, NakedPts
edgelengths = EdgeLengths(Mesh=unifynormals, LengthFactor=Slider(0, range=0..1), Strength=1)
anchor = Anchor(Point=nv.NakedPts, Strength=10000)
entwine = Entwine(Branch00=show, Branch01=edgelengths, Branch02=anchor, FlattenInputs=True)
bouncysolver = BouncySolver(GoalObjects=entwine, Reset=Button(), Threshold=1e-15, Tolerance=0.01, Damping=0.99, Iterations=10, On=Toggle(True))  # -> I, V, O
unflatten = UnflattenTree(Tree=bouncysolver.O, Guide=entwine)
bang = ExplodeTree(Data=unflatten)  # -> Branch0, Branch1
mesh_2 = Mesh(bang.Branch0)
preview = CustomPreview(Geometry=mesh_2, Material=ColourSwatch(SwatchColor=RGB(255, 255, 255)))
nv_2 = NakedVertices(Mesh=mesh_2)  # -> ClothedIndex, NakedIndex, ClothedPts, NakedPts
pt = Point(nv_2.NakedPts)

# ---- group: Material
division = Division(A="39000", B="2")
ndmaterial_alpaca4d = NDMaterialAlpaca4d(MatName="S235", E="39000", G=division, V=0.3, Rho="25", Fy=23.5)

# ----
wbnaked = WeaverbirdsNakedBoundary(MeshClosedPolylines=mesh_2)
sort = SortList(Keys=wbnaked, ValuesA=wbnaked)  # -> Keys, ValuesA
item = ListItem(List=sort.ValuesA, Index=0, Wrap=True)

# ---- group: Cross-Section
shell_section_alpaca4d = ShellSectionAlpaca4d(SectionName="Cls", Thickness="300", NDMaterial=ndmaterial_alpaca4d)

# ----
explode = Explode(Curve=item, Recursive=True)  # -> Segments, Vertices
duppt = RemoveDuplicatePts(Points=explode.Vertices, Tolerance=0.01)
pt_2 = Point([<point referenced from the Rhino model> x25])
demesh = DeconstructMesh(Mesh=mesh_2)  # -> Vertices, Faces, Colours, Normals

# ---- group: Load
vector_xyz = VectorXYZ(XComponent="0", YComponent="-40", ZComponent=0)  # -> Vector, Length
point_load_alpaca4d = PointLoadAlpaca4d(Force=vector_xyz.Vector, Pos=demesh.Vertices)

# ---- group: Element
mesh_to_shell_alpaca4d = MeshToShellAlpaca4d(Mesh=mesh_2, Colour=ColourSwatch(SwatchColor=RGB(0, 91, 237)), CrossSection=shell_section_alpaca4d)

# ---- group: Support
point = Point(duppt)
toggle = BooleanToggle(True)
toggle_2 = BooleanToggle(True)
support = SupportAlpaca4d(Pos=point, Tx=toggle, Ty=toggle, Tz=toggle, Rx=toggle_2, Ry=toggle_2, Rz=toggle)

# ----
assemble_model_alpaca_4d = AssembleModelAlpaca4d(Element=flatten(mesh_to_shell_alpaca4d), Support=flatten(support), Load=flatten(point_load_alpaca4d))  # -> AlpacaModel, MassOfStructure
static_analyses = StaticAnalysesAlpaca4d(AlpacaModel=assemble_model_alpaca_4d.AlpacaModel)
gradientlibrary = GradientLibraryAlpaca4d(GradientIndex=Slider(4, range=0..12))
static_model_view = StaticModelViewAlpaca4d(AlpacaStaticOutput=static_analyses, Direction=Slider(1, range=0..3), ColorList=reverse(gradientlibrary))  # -> ModelDisp, DisplacementRange
mjoin_2 = MeshJoin(Meshes=static_model_view.ModelDisp)
weldvertices = MeshWeldVertices(Mesh=mjoin_2, Tolerance=0.01)  # -> RuntimeMessage, Mesh

# ----
# CHOOSE
# YOUR COLOUR
panel = Panel("9")
range = Range(Domain=Domain(0, 1), Steps=panel)
twnthrucols = TweenThroughColors(
    Colors=gradientlibrary,
    Factor=range,
    Normalized=True,
    Equalized=False,
    Weighted=False,
    Degree=3,
    InterpolationType=0,
    Alpha=True)

# ----
# Legend Panel
panel_2 = Panel("10")
rectangle = Rectangle(Plane=PlaneXY(0, 0, 0), XSize="0.5", YSize=panel_2, Radius=0)  # -> Rectangle, Length
rectangle_2 = Rectangle(Plane=PlaneXY(0, 0, 0), XSize=panel_2, YSize="0.5", Radius=0)  # -> Rectangle, Length
boundary = BoundarySurfaces(Edges=rectangle_2.Rectangle)
divide = DivideDomain(Domain=boundary, UCount="1", VCount=10)
divide_2 = DivideDomain(Domain=boundary, UCount=10, VCount="1")
subsrf = Isotrim(Surface=boundary, Domain=divide_2)
explode_2 = MeshExplode(Mesh=subsrf, Interpolate=False)
mcol = MeshColours(Mesh=explode_2, Colours=graft(twnthrucols))  # -> flatten(Mesh)
mjoin_3 = MeshJoin(Meshes=mcol)
weldvertices_2 = MeshWeldVertices(Mesh=mjoin_3, Tolerance=0.01)  # -> RuntimeMessage, Mesh
size_of_the_legend = Slider(30, range=10..30)
pt_3 = ConstructPoint(XCoordinate=Slider(750, range=1..2000), YCoordinate=Slider(944, range=1..1000), ZCoordinate=0)
meshtoscreen = RenderMeshToScreen(Mesh=weldvertices_2.Mesh, Location=pt_3, ScaleFactor=Slider(54, range=1..70), Depth=0.95, Fixed=True, m_scWithvp=True)

mesh_3 = Mesh(weldvertices.Mesh)
medges = MeshEdges(Mesh=mesh_3)  # -> NakedEdges, InteriorEdges, NonManifoldEdges
crv = Curve(medges.NakedEdges)
crv_2 = Curve(medges.InteriorEdges)
previewlw = CustomPreviewLineweights(Geometry=crv, Shader=ColourSwatch(SwatchColor=RGB(0, 0, 0)), Thickness="3", Absolute=False)
previewlw_2 = CustomPreviewLineweights(Geometry=crv_2, Shader=ColourSwatch(SwatchColor=RGB(0, 0, 0)), Thickness="1", Absolute=False)
