# Grasshopper definition TrussExample.gh (Grasshopper 1.0.7)
# plug-ins: Alpaca4d, LunchBox

pi = Pi(Factor="5")
dom = ConstructDomain(DomainStart="0", DomainEnd=pi)
range = Range(Domain=dom, Steps=Slider(35, range=0..100))
remap = RemapNumbers(Value=range, Source=pi, Target=Domain(0, 1))  # -> Mapped, Clipped
graph = GraphMapper(remap.Mapped, x0=0, x1=1, y0=0, y1=1, container_name="Gaussian", factor=0.2, mean=0.5, sdev=0.1)
graph_2 = GraphMapper(
    remap.Mapped,
    x0=0,
    x1=1,
    y0=0,
    y1=1,
    container_name="Sinc",
    Equation_X0=0.5,
    Equation_X1=0.6,
    Equation_Y0=0.8,
    Equation_Y1=0.3)
graph_3 = GraphMapper(
    remap.Mapped,
    x0=0,
    x1=1,
    y0=0,
    y1=1,
    container_name="Sine",
    Equation_px=[0, 0.2529358864],
    Equation_py=[0, 0.5519758463])
graph_4 = GraphMapper(remap.Mapped, x0=0, x1=1, y0=0, y1=1, Ox=0.5, Oy=0, Px=0.75, Py=0.25, container_name="Parabola")
graph_5 = GraphMapper(remap.Mapped, x0=0, x1=1, y0=0, y1=1, Ox=0.4872109294, Oy=1, Px=0.9134680629, Py=0.2370004058, container_name="Parabola")
pt = ConstructPoint(XCoordinate=range, YCoordinate=0, ZCoordinate=graph_5)
intcrv = Interpolate(Vertices=pt, Degree=3, Periodic=False, KnotStyle=1)  # -> Curve, Length, Domain
Y = UnitY(Factor=Slider(5, range=0..10))
extr = Extrude(Base=intcrv.Curve, Direction=Y)
number_slider = Slider(4, range=0..10)
quads = QuadPanels(Surface=extr, UDivisions=number_slider, VDivisions=Slider(30, range=0..100))
md_slider = MDSlider(SliderMode=0, slider_value=Point(0.5, 0.5, 0.5), x_domain=Domain(0, 1), y_domain=Domain(0, 1), z_domain=Domain(0, 1))
evalsrf = EvaluateSurface(Surface=reparameterize(quads), Point=md_slider)  # -> Point, Normal, UDirection, VDirection, Frame
multiplication = Multiplication(A=evalsrf.Normal, B="0.5")
move = Move(Geometry=evalsrf.Point, Motion=multiplication)  # -> Geometry, Transform
debrep = DeconstructBrep(Brep=quads)  # -> Faces, Edges, Vertices
graft = GraftTree(Tree=move.Geometry, IncludeEmptyLists=True, IncludeNullItems=True)
sort_pt = SortPoints(Points=move.Geometry)  # -> Points, Indices
partition = PartitionList(List=sort_pt.Points, Size=number_slider)
ln = Line(StartPoint=debrep.Vertices, EndPoint=graft)
pdecon = Deconstruct(Point=partition)  # -> XComponent, YComponent, ZComponent
tstat = TreeStatistics(Tree=partition)  # -> Paths, Length, Count
pline = PolyLine(Vertices=partition, Closed=False)
sort = SortList(Keys=pdecon.YComponent, ValuesA=partition)  # -> Keys, ValuesA
subtraction = Subtraction(A=tstat.Count, B=1)
explode = Explode(Curve=pline, Recursive=True)  # -> Segments, Vertices
flip = FlipMatrix(Data=sort.ValuesA)
concat = Concatenate(FragmentA="{", FragmentB=subtraction, FragmentC="}")
pline_2 = PolyLine(Vertices=flip, Closed=False)
branch = TreeBranch(Tree=simplify(partition), Path=simplify(["{0}", concat]), MaintainPaths=True)
explode_2 = Explode(Curve=pline_2, Recursive=True)  # -> Segments, Vertices
line = Line(debrep.Edges)
line_2 = Line(ln)
line_3 = Line(explode.Segments)
line_4 = Line(explode_2.Segments)
noderestrain = Point(branch)
loadnode = Point(debrep.Vertices)
flatten = FlattenTree(Tree=debrep.Vertices, Path="{0}")
area = Area(Geometry=extr)  # -> Area, Centroid
lng = ListLength(List=flatten)
multiplication_2 = Multiplication(A="13", B=area.Area)
division = Division(A=multiplication_2, B=lng)
toggle = BooleanToggle(True)
vec = VectorXYZ(XComponent=0, YComponent=0, ZComponent=expr("-x", division))  # -> Vector, Length
uniaxialmaterial = UniaxialMaterialAlpaca4d(MatName="S235", E=210000, V=0.3, Rho=78.5, Fy=23.5)
division_2 = Division(A="50", B="10")
point_load = PointLoadAlpaca4d(Force=vec.Vector, Pos=loadnode)  # -> flatten(LoadWrapper)
support = SupportAlpaca4d(Pos=noderestrain, Tx=toggle, Ty=toggle, Tz=toggle)
circular_cross_section = CircularCrossSectionAlpaca4d(SectionName="Circular", Diameter="50", Thickness=division_2, UniaxialMaterial=uniaxialmaterial)
line_to_beam = LineToBeamAlpaca4d(
    Line=flatten([line, line_2, line_3, line_4]),
    Colour=ColourSwatch(SwatchColor=RGB(0, 200, 250)),
    CrossSection=circular_cross_section,
    BeamType=Button())  # -> flatten(BeamWrapper)
assemble_model = AssembleModelAlpaca4d(Element=flatten(line_to_beam), Support=flatten(support), Load=flatten(point_load))  # -> AlpacaModel, MassOfStructure
multiplication_3 = Multiplication(A=vec.Vector, B="0.25")
move_2 = Move(Geometry=loadnode, Motion=expr("-x", multiplication_3))  # -> Geometry, Transform
ndfanalyses = NDFAnalysesAlpaca4d(MarshallingSignalParameter=assemble_model.AlpacaModel)
vdisex = VectorDisplayEx(Point=move_2.Geometry, Vector=multiplication_3, Colour=ColourSwatch(SwatchColor=RGB(5, 0, 0)), Width=2)
visualisemodel = VisualiseModelAlpaca4d(AlpacaModel=assemble_model.AlpacaModel)  # -> AlpacaModel, Model
geo = Geometry(visualisemodel.Model)
number_slider_2 = Slider(3, range=0..10)
gradientlibrary = GradientLibraryAlpaca4d(GradientIndex=Slider(2, range=0..13))
static_model_view = StaticModelViewAlpaca4d(
    AlpacaStaticOutput=ndfanalyses,
    Scale=Slider(22, range=0..100),
    ModelExtrude=Toggle(False),
    Direction=Slider(3, range=0..10),
    ColorList=gradientlibrary)  # -> ModelDisp, DisplacementRange
