# Grasshopper definition waffle.gh (Grasshopper 1.0.7)
# plug-ins: MeshEdit Components, treesloth01, Pufferfish, Human, Kangaroo Components, ggRhinoIFC, karambaGH

gggrasshoppersettings = GgGrasshopperSettings(
    SettingsData_IFCSettings_Format="STEP",
    SettingsData_IFCSettings_GenerateOwnerHistory=True,
    SettingsData_IFCSettings_IdentifyObsolete=True,
    SettingsData_IFCSettings_LastUsedUnits="Meters",
    SettingsData_IFCSettings_Radians=True,
    SettingsData_IFCSettings_RepMapExport="NONE",
    SettingsData_IFCSettings_Target="Universal",
    SettingsData_IFCSettings_VersionIFC="IFC2x3",
    SettingsData_RevitSettings_Format="STEP",
    SettingsData_RevitSettings_GenerateOwnerHistory=True,
    SettingsData_RevitSettings_IdentifyObsolete=True,
    SettingsData_RevitSettings_LastUsedUnits="Meters",
    SettingsData_RevitSettings_Radians=True,
    SettingsData_RevitSettings_RepMapExport="NONE",
    SettingsData_RevitSettings_Target="Universal",
    SettingsData_RevitSettings_VersionIFC="IFC4")
cyl = Cylinder(Base=PlaneXY(0, 0, 0), Radius=0.5, Length=1)
cap = CapHoles(Brep=cyl)
brep = Brep(cap)
bbox = BoundingBox(Content=brep, Plane=PlaneXY(0, 0, 0))  # -> Box, Box_2
debrep = DeconstructBrep(Brep=bbox.Box)  # -> Faces, Edges, Vertices
area = MeshArea(Mesh=debrep.Faces)  # -> Area, Centroid
pdecon = Deconstruct(Point=area.Centroid)  # -> XComponent, YComponent, ZComponent
sort = SortList(Keys=pdecon.ZComponent, ValuesA=debrep.Faces)  # -> Keys, ValuesA
item = ListItem(List=sort.ValuesA, Index=0, Wrap=True)
number_slider = Slider(0.2, range=0.1..2)
srf = Surface(item)
X = UnitX(Factor=1)
Y = UnitY(Factor=1)
contour = Contour(Shape=srf, Point=Point(0, 0, 0), Direction=Y, Distance=number_slider)
contour_2 = Contour(Shape=srf, Point=Point(0, 0, 0), Direction=X, Distance=number_slider)
Z = UnitZ(Factor=1)
end = EndPoints(Curve=contour)  # -> Start, End
end_2 = EndPoints(Curve=contour_2)  # -> Start, End
move = Move(Geometry=end.Start, Motion=Z)  # -> Geometry, Transform
move_2 = Move(Geometry=end_2.Start, Motion=Z)  # -> Geometry, Transform
lnpt = LinePt(Line=contour_2, Point=move_2.Geometry)
lnpt_2 = LinePt(Line=contour, Point=move.Geometry)
sec = BrepPlane(Brep=brep, Plane=lnpt)  # -> Curves, Points
sec_2 = BrepPlane(Brep=brep, Plane=lnpt_2)  # -> Curves, Points
crv = Curve(sec.Curves)
crv_2 = Curve(sec_2.Curves)
clean = CleanTree(RemoveNulls=True, RemoveInvalid=True, RemoveEmpty=invert(False), Tree=crv)  # -> flatten(Tree)
clean_2 = CleanTree(RemoveNulls=True, RemoveInvalid=True, RemoveEmpty=invert(False), Tree=crv_2)  # -> flatten(Tree)
graft = GraftTree(Tree=clean, IncludeEmptyLists=True, IncludeNullItems=True)
graft_2 = GraftTree(Tree=clean_2, IncludeEmptyLists=True, IncludeNullItems=True)
renumber = RenumberPaths(Data=graft)
renumber_2 = RenumberPaths(Data=graft_2)
stack = StackTrees(Tree0=renumber, Tree1=renumber_2, Reduce=True)
tstat = TreeStatistics(Tree=renumber)  # -> Paths, Length, Count
split = SplitTree(Data=stack, Masks=flatten(tstat.Paths))  # -> Positive, Negative
number_slider_2 = Slider(0.386, range=0..5)
bbx = BrepBrep(BrepA=split.Positive, BrepB=flatten(split.Negative))  # -> simplify(Curves), Points
ext = ExtendCurve(Curve=bbx.Curves, Type=0, Start=number_slider_2, End=number_slider_2)
end_3 = EndPoints(Curve=ext)  # -> Start, End
thickness = Panel("0.02")
ln = Line(StartPoint=end_3.Start, EndPoint=end_3.End)
vec2pt = Vector2Pt(PointA=end_3.Start, PointB=end_3.End, Unitize=False)  # -> Vector, Length
neg = Negative(Value=thickness)
pframe = PerpFrame(Curve=ln, Parameter="0.0")
dom = ConstructDomain(DomainStart=neg, DomainEnd=thickness)
rectangle = Rectangle(Plane=pframe, XSize=dom, YSize=dom, Radius=0)  # -> Rectangle, Length
boundary = BoundarySurfaces(Edges=rectangle.Rectangle)
extr = Extrude(Base=boundary, Direction=vec2pt.Vector)
pframe_2 = PerpFrame(Curve=ln, Parameter=Slider(0.5, range=0..1))
xy = XYPlane(Origin=pframe_2)
planesrf = PlaneSurface(Plane=xy, XSize=Domain(-10, 10), YSize=Domain(-10, 10))
split_2 = SplitBrep(Brep=extr, Cutter=planesrf)  # -> simplify(Result)
cap_2 = CapHoles(Brep=split_2)
path_mapper = PathMapper(cap_2, source="{a;b}", target="{b;a}")
data = Data(path_mapper)
item_2 = ListItem(List=cap_2, Index=0, Wrap=True)  # -> Item, Item1
shift = ShiftPaths(Data=item_2.Item, Offset=-1)
sec_3 = BrepPlane(Brep=shift, Plane=split.Positive)  # -> Curves, Points
geo = Geometry(split.Positive)
shift_2 = ShiftPaths(Data=sec_3.Curves, Offset=-1)
geo_2 = Geometry(split.Negative)
rdiff = RegionDifference(CurvesA=geo, CurvesB=shift_2)
merge = Merge(Data1=geo, Data2=geo_2)
geo_3 = Geometry(merge)
vec = Vector(Z)
timer = Timer(TimerInterval=20, Target=counter)  # disabled
counter = Counter(Reset=Toggle(True))
panel = Panel(counter)
pt = ConstructPoint(XCoordinate="0.1", YCoordinate=0, ZCoordinate=0)
rad = Radians(Degrees=counter)
vec_2 = VectorXYZ(XComponent=Slider(0.29, range=0..1), YComponent=Slider(0, range=0..1), ZComponent=Slider(0, range=0..1))  # -> Vector, Length
pl = PlaneNormal(Origin=pt, ZAxis=vec_2.Vector)
gradientlibrary = GradientLibrary(gradIndex=11)  # -> colors; inputs gradIndex: Int32
#   port colors: A series of colors to be plugged into the "Ladybug_Legend Parameters" component.
# ---------- gradientlibrary: Python ----------
"""
Preset of gradient colors perfect for Data Visualisation
    Inputs:
        gradIndex: An index refering to one of the following possible gradients:
            0 - Orignal Ladybug
            1 - Nuanced Ladybug
            2 - Multi-colored Ladybug
            3 - Ecotect
            4 - Thermal Comfort Percentage
            5 - Thermal Comfort Colors
            6 - Shade Benefit/Harm
            7 - Shade Harm
            8 - Shade Benefit
            9 - CFD Colors 1
            10 - Radiation Benefit
            11 - Gsa10 Colour
            12 - Gsa9 Colour
    Returns:
        customColors: A series of colors.
"""

ghenv.Component.Name = "Gradient Library"
ghenv.Component.NickName = 'GradientLibrary'
#ghenv.Component.Message = 'GradientLibrary\nWIP'

import scriptcontext as sc
import Grasshopper.Kernel as gh
import System

gradientLibrary = {
        0: [System.Drawing.Color.FromArgb(75, 107, 169), System.Drawing.Color.FromArgb(115, 147, 202), System.Drawing.Color.FromArgb(170, 200, 247), System.Drawing.Color.FromArgb(193, 213, 208), System.Drawing.Color.FromArgb(245, 239, 103), System.Drawing.Color.FromArgb(252, 230, 74), System.Drawing.Color.FromArgb(239, 156, 21), System.Drawing.Color.FromArgb(234, 123, 0), System.Drawing.Color.FromArgb(234, 74, 0), System.Drawing.Color.FromArgb(234, 38, 0)],
        1: [System.Drawing.Color.FromArgb(49,54,149), System.Drawing.Color.FromArgb(69,117,180), System.Drawing.Color.FromArgb(116,173,209), System.Drawing.Color.FromArgb(171,217,233), System.Drawing.Color.FromArgb(224,243,248), System.Drawing.Color.FromArgb(255,255,191), System.Drawing.Color.FromArgb(254,224,144), System.Drawing.Color.FromArgb(253,174,97), System.Drawing.Color.FromArgb(244,109,67), System.Drawing.Color.FromArgb(215,48,39), System.Drawing.Color.FromArgb(165,0,38)],
        2: [System.Drawing.Color.FromArgb(4,25,145), System.Drawing.Color.FromArgb(7,48,224), System.Drawing.Color.FromArgb(7,88,255), System.Drawing.Color.FromArgb(1,232,255), System.Drawing.Color.FromArgb(97,246,156), System.Drawing.Color.FromArgb(166,249,86), System.Drawing.Color.FromArgb(254,244,1), System.Drawing.Color.FromArgb(255,121,0), System.Drawing.Color.FromArgb(239,39,0), System.Drawing.Color.FromArgb(138,17,0)],
        3: [System.Drawing.Color.FromArgb(0,0,255), System.Drawing.Color.FromArgb(53,0,202), System.Drawing.Color.FromArgb(107,0,148), System.Drawing.Color.FromArgb(160,0,95), System.Drawing.Color.FromArgb(214,0,41), System.Drawing.Color.FromArgb(255,12,0), System.Drawing.Color.FromArgb(255,66,0), System.Drawing.Color.FromArgb(255,119,0), System.Drawing.Color.FromArgb(255,173,0), System.Drawing.Color.FromArgb(255,226,0), System.Drawing.Color.FromArgb(255,255,0)],
        4: [System.Drawing.Color.FromArgb(0,0,0), System.Drawing.Color.FromArgb(110,0,153), System.Drawing.Color.FromArgb(255,0,0), System.Drawing.Color.FromArgb(255,255,102), System.Drawing.Color.FromArgb(255,255,255)],
        5: [System.Drawing.Color.FromArgb(0,136,255), System.Drawing.Color.FromArgb(200,225,255), System.Drawing.Color.FromArgb(255,255,255), System.Drawing.Color.FromArgb(255,230,230), System.Drawing.Color.FromArgb(255,0,0)],
        6: [System.Drawing.Color.FromArgb(5,48,97), System.Drawing.Color.FromArgb(33,102,172), System.Drawing.Color.FromArgb(67,147,195), System.Drawing.Color.FromArgb(146,197,222), System.Drawing.Color.FromArgb(209,229,240), System.Drawing.Color.FromArgb(255,255,255), System.Drawing.Color.FromArgb(253,219,199), System.Drawing.Color.FromArgb(244,165,130), System.Drawing.Color.FromArgb(214,96,77), System.Drawing.Color.FromArgb(178,24,43), System.Drawing.Color.FromArgb(103,0,31)],
        7: [System.Drawing.Color.FromArgb(255,255,255), System.Drawing.Color.FromArgb(253,219,199), System.Drawing.Color.FromArgb(244,165,130), System.Drawing.Color.FromArgb(214,96,77), System.Drawing.Color.FromArgb(178,24,43), System.Drawing.Color.FromArgb(103,0,31)],
        8: [System.Drawing.Color.FromArgb(255,255,255), System.Drawing.Color.FromArgb(209,229,240), System.Drawing.Color.FromArgb(146,197,222), System.Drawing.Color.FromArgb(67,147,195), System.Drawing.Color.FromArgb(33,102,172), System.Drawing.Color.FromArgb(5,48,97)],
        9: [System.Drawing.Color.FromArgb(0,16,120), System.Drawing.Color.FromArgb(38,70,160), System.Drawing.Color.FromArgb(5,180,222), System.Drawing.Color.FromArgb(16,180,109), System.Drawing.Color.FromArgb(59,183,35), System.Drawing.Color.FromArgb(143,209,19), System.Drawing.Color.FromArgb(228,215,29), System.Drawing.Color.FromArgb(246,147,17), System.Drawing.Color.FromArgb(243,74,0), System.Drawing.Color.FromArgb(255,0,0)],
        10: [System.Drawing.Color.FromArgb(0,191,48), System.Drawing.Color.FromArgb(255,238,184), System.Drawing.Color.FromArgb(255,0,0)],
        11: [System.Drawing.Color.FromArgb(204,0,71), System.Drawing.Color.FromArgb(255,182,71), System.Drawing.Color.FromArgb(206,255,115), System.Drawing.Color.FromArgb(26,180, 214),System.Drawing.Color.FromArgb(0,0,207)],
        12: [System.Drawing.Color.FromArgb(255, 51, 51), System.Drawing.Color.FromArgb(255, 170, 51), System.Drawing.Color.FromArgb(255, 255, 51), System.Drawing.Color.FromArgb(170, 255, 125), System.Drawing.Color.FromArgb(51, 255, 231), System.Drawing.Color.FromArgb(51, 170, 255), System.Drawing.Color.FromArgb(51,51, 255)]}
colors = gradientLibrary[gradIndex]
# ---------- end gradientlibrary ----------
number_slider_3 = Slider(3, range=1..3)
swatch = ColourSwatch(SwatchColor=RGB(0, 0, 0))

item_3 = ListItem(List=data, Index=0, Wrap=True)  # -> Item, Item1
shift_3 = ShiftPaths(Data=item_3.Item1, Offset=-1)
sec_4 = BrepPlane(Brep=shift_3, Plane=split.Negative)  # -> Curves, Points
shift_4 = ShiftPaths(Data=sec_4.Curves, Offset=-1)

match = MatchTree(Tree=shift_4, Guide=geo_2)

rdiff_2 = RegionDifference(CurvesA=geo_2, CurvesB=match)

merge_2 = Merge(Data1=shift_2, Data2=match)
geo_4 = Geometry(merge_2)
rdiff_3 = RegionDifference(CurvesA=geo_4, CurvesB=geo_3)
merge_3 = Merge(Data1=rdiff, Data2=rdiff_2)
boundary_2 = BoundarySurfaces(Edges=merge_3)  # -> simplify(Surfaces)
rdiff_4 = RegionDifference(CurvesA=geo_4, CurvesB=rdiff_3)  # -> simplify(Result)
graft_3 = GraftTree(Tree=rdiff_4, IncludeEmptyLists=True, IncludeNullItems=True)
disc = Discontinuity(Curve=rdiff_4, Level=1)  # -> Points, Parameters
shatter = Shatter(Curve=graft_3, Parameters=simplify(disc.Parameters))
dprod = DotProduct(VectorA=shatter, VectorB=vec, Unitize=False)
abs = Absolute(Value=dprod)
similar = Similarity(FirstNumber=abs, SecondNumber="1.0", Threshold=0.1)  # -> Similarity, AbsoluteDifference
cull = CullPattern(List=shatter, CullPattern=similar.Similarity)
item_4 = ListItem(List=cull, Index=0, Wrap=True)  # -> Item, Item1
flip = FlipCurve(Curve=item_4.Item1)  # -> Curve, Flag
merge_4 = Merge(Data1=item_4.Item, Data2=flip.Curve)
len = Length(Curve=merge_4)
sort_2 = SortList(Keys=len, ValuesA=merge_4)  # -> Keys, ValuesA
item_5 = ListItem(List=sort_2.ValuesA, Index=0, Wrap=True)  # -> Item, Item1
divide = DivideCurve(Curve=item_5.Item, Count=10, Kinks=False)  # -> Points, Tangents, Parameters
crv_cp = CurveClosestPoint(Point=divide.Points, Curve=item_5.Item1)  # -> Point, Parameter, Distance
ln_2 = Line(StartPoint=divide.Points, EndPoint=crv_cp.Point)
crv_3 = Curve(reparameterize(ln_2))
shatter_2 = Shatter(Curve=crv_3, Parameters="0.50")
join = JoinCurves(Curves=shatter_2, Preserve=False)  # -> simplify(Curves)
explode = Explode(Curve=join, Recursive=True)  # -> Segments, Vertices
shift_5 = ShiftPaths(Data=simplify(explode.Vertices), Offset=-1)
shift_6 = ShiftPaths(Data=simplify(shift_5), Offset=-1)
duppt = RemoveDuplicatePts(Points=flatten(shift_6), Tolerance=0.01)
srf_cp = SurfaceClosestPoint(Point=duppt, Surface=boundary_2)  # -> Point, UVPoint, Distance
smaller = SmallerThan(FirstNumber=srf_cp.Distance, SecondNumber="0.01")  # -> SmallerThan, OrEqualTo
cull_2 = CullPattern(List=duppt, CullPattern=smaller.SmallerThan)
mesh_breps = MeshBrepsKaramba3D(
    Brep=boundary_2,
    InclusionPoints=cull_2,
    MeshResolution="0.2",
    EdgeRefinementFactor=0.67,
    PointReduction=False,
    SmoothingStepSize=0,
    SmoothingIterations=5)  # -> Mesh, Info
weldvertices = MeshWeldVertices(Mesh=mesh_breps.Mesh, Tolerance="0.01")  # -> RuntimeMessage, Mesh
geo_5 = Geometry([weldvertices.Mesh, join])
geo_6 = Geometry(flatten(geo_5))
group = Group(Objects=geo_6)
ungroup = Ungroup(Group=group)
rotate = Rotate(Geometry=ungroup, Angle=rad, Plane=pl)  # -> Geometry, Transform
crv_4 = Curve(rotate.Geometry)
mesh = Mesh(rotate.Geometry)
clean_3 = CleanTree(RemoveNulls=True, RemoveInvalid=True, RemoveEmpty=False, Tree=mesh)
clean_4 = CleanTree(RemoveNulls=True, RemoveInvalid=True, RemoveEmpty=False, Tree=crv_4)
lng = ListLength(List=clean_3)
range = Range(Domain=Domain(0, 1), Steps=expr("x-1", lng))
medges = MeshEdges(Mesh=clean_3)  # -> NakedEdges, InteriorEdges, NonManifoldEdges
twnthrucols = TweenThroughColors(
    Colors=gradientlibrary,
    Factor=range,
    Normalized=True,
    Equalized=False,
    Weighted=False,
    Degree=3,
    InterpolationType=0,
    Alpha=True)
jitter = Jitter(List=flatten(twnthrucols), Jitter=1, Seed=2)  # -> Values, Indices
previewlw = CustomPreviewLineweights(Geometry=medges.NakedEdges, Shader=swatch, Thickness=number_slider_3, Absolute=False)
previewlw_2 = CustomPreviewLineweights(Geometry=medges.InteriorEdges, Shader=swatch, Thickness=Slider(1, range=1..3), Absolute=False)
preview = CustomPreview(Geometry=clean_3, Material=jitter.Values)
previewlw_3 = CustomPreviewLineweights(Geometry=clean_4, Shader=ColourSwatch(SwatchColor=RGB(255, 255, 255)), Thickness=number_slider_3, Absolute=False)
