# Grasshopper definition Slab_SpeedTest.gh (Grasshopper 1.0.7)
# plug-ins: Weaverbird, karambaGH, ggGHgsa, treesloth01, Kangaroo2 Components, Pufferfish, Human, Wombat

rectangle = Rectangle(Plane=PlaneXY(0, 0, 0), XSize="8.00", YSize="8.00", Radius=0)  # -> Rectangle, Length
rectangle_2 = Rectangle(Plane=PlaneXY(0, 0, 0), XSize="8.00", YSize="8.00", Radius=0)  # -> Rectangle, Length
mplane = MeshPlane(Boundary=rectangle_2.Rectangle, WidthCount=10, HeightCount=10)  # -> Mesh, Area
smesh = SimpleMesh(Brep=rectangle.Rectangle)
refine = Refine(Mesh=mplane.Mesh, Level=1)
wbcatmullclark = WeaverbirdsCatmullClarkSubdivision(MeshCurves=smesh, Level="4", SmoothNakedEdges=1)
mesh = Mesh(refine)
refine_2 = Refine(Mesh=mesh, Level="3")
item = ListItem(List=refine_2, Index=0, Wrap=True)
wbnaked = WeaverbirdsNakedBoundary(MeshClosedPolylines=item)
pcen = PolygonCenter(Polyline=wbnaked)  # -> CenterV, CenterE, CenterA
pdecon = Deconstruct(Point=pcen.CenterV)  # -> XComponent, YComponent, ZComponent
sort = SortList(Keys=pdecon.ZComponent, ValuesA=wbnaked)  # -> Keys, ValuesA
item_2 = ListItem(List=sort.ValuesA, Index=0, Wrap=True)
splitatcorners = SplitAtCorners(Poly=item_2, Angle=1)  # -> Corners, Parts
# Format Engineers CAD Information Issue Disclaimer
# 
# Project: PROJECT NAME
# 
# You should use this model for reference purposes only to assist in co-ordinating your work and is supplementary to formally issued drawings. Once the data is introduced into your own CAD or other system Format Engineers Ltd. can take no responsibility for its accuracy.
# 
# The last set of formally issued paper drawings are the contractual documents which represent the current stage of design development. If you have any queries, please contact the project CAD co-ordinator or the CAD Development Team.
# 
# Changes:
# 
# YYYY-MM-DD: Summary of changes
# 
# Usage notes:
# 
# This definition includes a basic implementation of Merbarki's Farthest Point Seeding algorithm (2005), adapted for tracing lines of principal curvature on NURBS surfaces. Requires modified Triangle.NET, if this isn't attached then... good luck! There are currently two main limitations: (a) this implementation measures density in parameter space, and (b) it doesn't include the dynamic refinement of density that Mebarki suggests.
gggrasshoppersettings = GgGrasshopperSettings(SettingsData_NewFile=True, SettingsData_PlaceInClipboard=False, SettingsData_Version="v10_1")
item_3 = ListItem(List=splitatcorners.Parts, Index=0, Wrap=True)  # -> Item, Item1, Item2, Item3
crv = Curve(item_3.Item)
crv_2 = Curve(item_3.Item2)
merge = Merge(Data1=crv, Data2=crv_2)
explode = Explode(Curve=merge, Recursive=True)  # -> Segments, flatten(Vertices)
demesh = DeconstructMesh(Mesh=mesh)  # -> Vertices, Faces, Colours, Normals
cullpt = CullDuplicates(Points=flatten(demesh.Vertices), Tolerance=0.1, CullMode=3)  # -> Points, Indices, Valence
cullpt_2 = CullDuplicates(Points=explode.Vertices, Tolerance="0.01", CullMode=3)  # -> Points, Indices, Valence

e_n_m2 = Panel("210e9")
v_poisson = Panel("0.3")
panel = Panel("7850")  # "kg/m3"
meter = Panel("0.10")
num = Number(e_n_m2)

panel_2 = Panel("""True
True
True
True
True
True""")
support = Point(cullpt_2.Points)

number_vibration_modes = Panel("3")
clr = ColorsAlpaca4d(gradIndex=Slider(12, range=0..12))  # -> reverse(colors); inputs gradIndex: Int32
#   port colors: A series of colors to be plugged into the "Ladybug_Legend Parameters" component.
# ---------- clr: Python ----------
"""
Preset of gradient colors perfect for Data Visualisation
    Inputs:
        gradIndex: An index refering to one of the following possible gradients:
            0 - Orignal Ladybug
            1 - Nuanced Ladybug
            2 - Multi-colored Ladybug
            3 - Ecotect
            4 - Thermal Comfort Percentage
            5 - Thermal Comfort Colors
            6 - Shade Benefit/Harm
            7 - Shade Harm
            8 - Shade Benefit
            9 - CFD Colors 1
            10 - Radiation Benefit
            11 - Gsa10 Colour
            12 - Gsa9 Colour
    Returns:
        customColors: A series of colors.
"""

ghenv.Component.Name = "Colors (Alpaca4d)"
ghenv.Component.NickName = 'CLR'
ghenv.Component.Message = 'Colors (Alpaca4d)'

import scriptcontext as sc
import Grasshopper.Kernel as gh
import System

gradientLibrary = {
        0: [System.Drawing.Color.FromArgb(75, 107, 169), System.Drawing.Color.FromArgb(115, 147, 202), System.Drawing.Color.FromArgb(170, 200, 247), System.Drawing.Color.FromArgb(193, 213, 208), System.Drawing.Color.FromArgb(245, 239, 103), System.Drawing.Color.FromArgb(252, 230, 74), System.Drawing.Color.FromArgb(239, 156, 21), System.Drawing.Color.FromArgb(234, 123, 0), System.Drawing.Color.FromArgb(234, 74, 0), System.Drawing.Color.FromArgb(234, 38, 0)],
        1: [System.Drawing.Color.FromArgb(49,54,149), System.Drawing.Color.FromArgb(69,117,180), System.Drawing.Color.FromArgb(116,173,209), System.Drawing.Color.FromArgb(171,217,233), System.Drawing.Color.FromArgb(224,243,248), System.Drawing.Color.FromArgb(255,255,191), System.Drawing.Color.FromArgb(254,224,144), System.Drawing.Color.FromArgb(253,174,97), System.Drawing.Color.FromArgb(244,109,67), System.Drawing.Color.FromArgb(215,48,39), System.Drawing.Color.FromArgb(165,0,38)],
        2: [System.Drawing.Color.FromArgb(4,25,145), System.Drawing.Color.FromArgb(7,48,224), System.Drawing.Color.FromArgb(7,88,255), System.Drawing.Color.FromArgb(1,232,255), System.Drawing.Color.FromArgb(97,246,156), System.Drawing.Color.FromArgb(166,249,86), System.Drawing.Color.FromArgb(254,244,1), System.Drawing.Color.FromArgb(255,121,0), System.Drawing.Color.FromArgb(239,39,0), System.Drawing.Color.FromArgb(138,17,0)],
        3: [System.Drawing.Color.FromArgb(0,0,255), System.Drawing.Color.FromArgb(53,0,202), System.Drawing.Color.FromArgb(107,0,148), System.Drawing.Color.FromArgb(160,0,95), System.Drawing.Color.FromArgb(214,0,41), System.Drawing.Color.FromArgb(255,12,0), System.Drawing.Color.FromArgb(255,66,0), System.Drawing.Color.FromArgb(255,119,0), System.Drawing.Color.FromArgb(255,173,0), System.Drawing.Color.FromArgb(255,226,0), System.Drawing.Color.FromArgb(255,255,0)],
        4: [System.Drawing.Color.FromArgb(0,0,0), System.Drawing.Color.FromArgb(110,0,153), System.Drawing.Color.FromArgb(255,0,0), System.Drawing.Color.FromArgb(255,255,102), System.Drawing.Color.FromArgb(255,255,255)],
        5: [System.Drawing.Color.FromArgb(0,136,255), System.Drawing.Color.FromArgb(200,225,255), System.Drawing.Color.FromArgb(255,255,255), System.Drawing.Color.FromArgb(255,230,230), System.Drawing.Color.FromArgb(255,0,0)],
        6: [System.Drawing.Color.FromArgb(5,48,97), System.Drawing.Color.FromArgb(33,102,172), System.Drawing.Color.FromArgb(67,147,195), System.Drawing.Color.FromArgb(146,197,222), System.Drawing.Color.FromArgb(209,229,240), System.Drawing.Color.FromArgb(255,255,255), System.Drawing.Color.FromArgb(253,219,199), System.Drawing.Color.FromArgb(244,165,130), System.Drawing.Color.FromArgb(214,96,77), System.Drawing.Color.FromArgb(178,24,43), System.Drawing.Color.FromArgb(103,0,31)],
        7: [System.Drawing.Color.FromArgb(255,255,255), System.Drawing.Color.FromArgb(253,219,199), System.Drawing.Color.FromArgb(244,165,130), System.Drawing.Color.FromArgb(214,96,77), System.Drawing.Color.FromArgb(178,24,43), System.Drawing.Color.FromArgb(103,0,31)],
        8: [System.Drawing.Color.FromArgb(255,255,255), System.Drawing.Color.FromArgb(209,229,240), System.Drawing.Color.FromArgb(146,197,222), System.Drawing.Color.FromArgb(67,147,195), System.Drawing.Color.FromArgb(33,102,172), System.Drawing.Color.FromArgb(5,48,97)],
        9: [System.Drawing.Color.FromArgb(0,16,120), System.Drawing.Color.FromArgb(38,70,160), System.Drawing.Color.FromArgb(5,180,222), System.Drawing.Color.FromArgb(16,180,109), System.Drawing.Color.FromArgb(59,183,35), System.Drawing.Color.FromArgb(143,209,19), System.Drawing.Color.FromArgb(228,215,29), System.Drawing.Color.FromArgb(246,147,17), System.Drawing.Color.FromArgb(243,74,0), System.Drawing.Color.FromArgb(255,0,0)],
        10: [System.Drawing.Color.FromArgb(0,191,48), System.Drawing.Color.FromArgb(255,238,184), System.Drawing.Color.FromArgb(255,0,0)],
        11: [System.Drawing.Color.FromArgb(204,0,71), System.Drawing.Color.FromArgb(255,182,71), System.Drawing.Color.FromArgb(206,255,115), System.Drawing.Color.FromArgb(26,180, 214),System.Drawing.Color.FromArgb(0,0,207)],
        12: [System.Drawing.Color.FromArgb(255, 51, 51), System.Drawing.Color.FromArgb(255, 170, 51), System.Drawing.Color.FromArgb(255, 255, 51), System.Drawing.Color.FromArgb(170, 255, 125), System.Drawing.Color.FromArgb(51, 255, 231), System.Drawing.Color.FromArgb(51, 170, 255), System.Drawing.Color.FromArgb(51,51, 255)]}
colors = gradientLibrary[gradIndex]
# ---------- end clr ----------
deformed_factor = Panel("10")
python = GhPythonScript(support=panel_2)  # -> out, KarambaSupport, Gsa_AlpacaSupport; inputs support: list
# ---------- python: Python ----------
KarambaSupport = []

for i,dof in enumerate(support):
    print(dof)
    if dof == "True":
        KarambaSupport.append(i)
        print("I am in")



Gsa_AlpacaSupport = support
# ---------- end python ----------

# ----
# Load Case
panel_3 = Panel("TestLoad")  # disabled
panel_4 = Panel("DL")  # disabled
panel_5 = Panel("2")  # disabled
panel_6 = Panel("1")  # disabled
gglc = GgGSALoadCase(Name=panel_4, ID=panel_6, LoadCaseType=6, Bridge=False)  # disabled
gglc_2 = GgGSALoadCase(Name=panel_3, ID=panel_5, LoadCaseType=6, Bridge=False)  # disabled

# ----
# Material
# Note: Custom Elastic material or some predefined one. The same that happen in Gsa.
data = Data(num)  # disabled
material_name = Panel("Steel")  # disabled
ggeim = GgGSACreateElasticIsotropicMaterial(
    Name=material_name,
    ElasticModulusPa=data,
    PoissonsRatio=0.3,
    ShearModulusPa=0,
    Density=7850,
    CoefficientOfThermalExpansion=1.2e-05,
    DampingRatio=0)  # disabled

# ----
# Cross Section
property_name = Panel("thickness")  # disabled
thickness = Number(meter)  # disabled
ggp2d = GgGSACreate2dFiniteElementProp(Name=property_name, Thickness=thickness, Material=ggeim)  # disabled

# ----
# Support
item_4 = ListItem(List=python.Gsa_AlpacaSupport, Index=0, Wrap=True)  # -> Item, Item1, Item2, Item3, Item4, Item5; disabled
pt = Point(support)  # disabled
ggnr = GgGSANodeRestraint(
    RestraintX=item_4.Item,
    RestraintY=item_4.Item1,
    RestraintZ=item_4.Item2,
    RestraintXX=item_4.Item3,
    RestraintYY=item_4.Item4,
    RestraintZZ=item_4.Item5)  # disabled
ggna = GgGSANodeAtts(Restraint=ggnr, LocalElementSize=0, LowID=1, DetectTol=0)  # disabled
ggnode = GgGSACreateOrFindNode(Location=pt, NodeAtts=ggna)  # disabled

# ----
# Mesh to Shell
mesh_2 = Mesh(mesh)  # disabled
ggmfe = GgGSAMeshConvertFiniteElements(Prop=ggp2d, Mesh=mesh_2, Angle=0, QuadShapeCheckAcceptance=0)  # -> StructureModelFiniteElements, StructureModelNodes, MeshIdentifyingFacesBreachingShapeChecks; disabled

# ----
# Apply Load to elements
gggl = GgGSALoadGravity(LoadCase=gglc, XGravityFactor=0, YGravityFactor=0, ZGravityFactor=-1)  # disabled

# ----
# Load Combination
panel_7 = Panel("""DL,SDL
1,0
0,1""")  # disabled
panel_8 = Panel(",")  # disabled
split = TextSplit(Text=panel_7, Separators=panel_8)  # -> simplify(Result); disabled

num_2 = Number(number_vibration_modes)  # disabled

# ----
# Modal Analyses
panel_9 = Panel("L1")  # disabled
ggma = GgGSAAnalysisModalOptions(
    SolverRestraint=0,
    MassCalculationOption=1,
    MassScaleFactor=1,
    MassLoadCase=panel_9,
    LoadCaseMassDirection=2,
    LoadCaseScaleFactor=1,
    StiffnessProportion=1,
    MassProportion=1,
    SturmSequenceCheck=True,
    IgnoreElementOffsets=False,
    NormalizeDisplacements=True,
    ScaleFactorNormalization=1,
    NumberOfJacobiIterations=12)  # disabled
panel_10 = Panel("Natural Vibration")  # disabled
panel_11 = Panel("Modal Analyses")  # disabled
ggma_2 = GgGSAAnalysisModal(
    Name=panel_10,
    ID=0,
    NumberOfModes=num_2,
    NumberOfIterations=128,
    StartMode=1,
    LowerFrequencyCutoff=0,
    HigherFrequencyCutoff=0,
    ModalSolverOptions=ggma)  # disabled
ggac = GgGSAAnalysisCase(Name=panel_11, ID=1, StructAnalysisTask=ggma_2)  # disabled

# ----
# Copy Model in the Clipboard
# Note: This method always works!
# It is the best way to go inside Gsa
# Note: There is also a way to ge the results back in Grasshopper. Helpful if you need to perform complex analyses and optimise
bake_gwa = GgGSABakeGWA()  # disabled

# ----
# or
# Open model in Gsa
# Note: Gsa should be already be opened in your computer. Right click to select the correct Version of your Gsa
gggsabake = GgGSABakeModel()  # disabled

panel_12 = Panel("")  # disabled

# ----
# Create some queries
# Read Result in Gh
ggmd = GgGSAModelDecompose(ActiveToggle=True)  # -> ModelSummary, Nodes, BeamElements, AreaElements, Materials, SectionProperties, AreaProperties, LoadCases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; disabled
toggle = BooleanToggle(True)  # disabled

item_5 = ListItem(List=ggmd.LoadCases, Index=0, Wrap=True)  # -> Item, Item1; disabled
toggle_2 = BooleanToggle(True)  # disabled
ggq2dprojmom = GgGSAQuery2dProjectedMoments(
    FiniteElements=flatten(ggmd.AreaElements),
    Case=item_5.Item1,
    Mx=toggle,
    My=toggle,
    Mxy=toggle,
    MxMxy=toggle,
    MyMyx=toggle)  # disabled
ggquery2dprojfor = GgGSAQuery2dProjectedForces(
    FiniteElements=flatten(ggmd.AreaElements),
    Case=item_5.Item1,
    Nx=toggle_2,
    Ny=toggle_2,
    Nxy=toggle_2,
    Qx=toggle_2,
    Qy=toggle_2)  # disabled
ggqnodedisp = GgGSAQueryNodeDisplacements(Nodes=flatten(ggmd.Nodes), Case=item_5.Item1)  # disabled
ggqnodereactf = GgGSAQueryNodeReactionForce(Nodes=flatten(ggnode), Case=item_5.Item1)  # disabled
ggqnodereactm = GgGSAQueryNodeReactionMoment(Nodes=flatten(ggnode), Case=item_5.Item1)  # disabled
ggqueryfrequency = GgGSAQueryFrequency(Case=flatten(ggac))  # disabled
entwine = Entwine(
    Branch00=ggqnodedisp,
    Branch01=ggquery2dprojfor,
    Branch02=ggq2dprojmom,
    Branch03=ggqnodereactf,
    Branch04=ggqnodereactm,
    Branch05=ggqueryfrequency,
    FlattenInputs=True)  # disabled
toggle_3 = BooleanToggle(True)  # disabled
bake_gwa_2 = GgGSABakeQuickGWA()  # disabled
ggbs = GgGSABakeModel(Version=5, NewModel=True, Enabled=False)  # -> Succeeded, APIObject, Log; disabled

# ----
# Visualize Stress
list = ValueList({"p11": 0, "p22": 1, "p12": 2, "m11": 3, "m22": 4, "m12": 5, "q1": 6, "q2": 7}, selected="m11")  # disabled

# ----
# Dispalcement
panel_13 = Panel("Displacement")
panel_14 = Panel("""Alpaca4d

Number of Points """)

# ----
# Undeformed Model
tri = Triangulate(Mesh=mesh)  # -> Mesh, Count
flatten = FlattenTree(Tree=mesh, Path="{0}")
flatten_2 = FlattenTree(Tree=mesh, Path="{0}")
flatten_3 = FlattenTree(Tree=tri.Mesh, Path="{0}")
mjoin = MeshJoin(Meshes=flatten)
mjoin_2 = MeshJoin(Meshes=flatten_3)
mjoin_3 = MeshJoin(Meshes=flatten_2)
entwine_2 = Entwine(Branch00=mjoin, Branch01=mjoin_2, Branch02=mjoin_3, FlattenInputs=True)  # -> flatten(Result)

panel_15 = Panel("/")
panel_16 = Panel("0")  # disabled
panel_17 = Panel("10")  # disabled
X = UnitX(Factor=panel_17)  # disabled

newton = Panel("10000")
point_load = Point(cullpt.Points)

neg = Negative(Value=newton)

Z = UnitZ(Factor=neg)

data_2 = Data(point_load)
data_3 = Data(Z)

pt_2 = Point(support)
mesh_3 = Mesh(refine_2)
num_3 = Number(expr("x*100", meter))
vec = Vector(expr("x/1000", Z))
data_4 = Data(point_load)
pt_3 = Point(support)
cross_section = CrossSectionKaramba3D(FamilyNameOfCrossSection="DefaultCroSec", Material=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, Height_cm=num_3, mode="Shell - Const")
num_4 = Number(python.KarambaSupport)
supp = SupportKaramba3D(PosInd=pt_3, Dofs=num_4, menu=[buttons(off, off, off, off, off, off)])
meshtoshell = MeshToShellKaramba3D(Mesh=mesh_3, CrossSection=cross_section, LimitDistance_m=0.005)  # -> Element, Points, Info
loads = LoadsKaramba3D(ForceVector=vec, Local=False, PosInd=data_4, LCase="0", mode="Point")
panel_18 = Panel(supp)
assemble = AssembleModelKaramba3D(Elem=flatten(meshtoshell.Element), Support=flatten(supp), Load=flatten(loads), LimitDistance_m="0.0001")  # -> Model, Info, Mass_kg, CenterOfGravity, LoadCaseNames
python_2 = GhPythonScript(colorInput=clr)  # -> colors; inputs colorInput: list
# ---------- python_2: Python ----------
firstItem = [colorInput[0]]
lasttItem = [colorInput[-1]]

colors = firstItem + colorInput + lasttItem
# ---------- end python_2 ----------
analyze = AnalyzeKaramba3D(Model=assemble.Model)  # -> CalculatedModel, MaximumDisplacement_cm, ResultingForceOfGravity_kN, ElasticEnergy_kNm
modelview = ModelViewKaramba3D(Model=analyze.CalculatedModel, ResultFactors=deformed_factor, ResultCase=-1, Colors=python_2)  # -> Model, DeformedMesh, DeformedAxes, DeformedModel
shellview = ShellViewKaramba3D(Model=modelview.Model, IndexOfLayer=0)  # -> Model, MeshesOfRenderedShells, LegendColors, LegendTags
react = ReactionForcesKaramba3D(AnalyzedModel=analyze.CalculatedModel, LoadCase="0")  # -> AnalyzedModel, ReactionForces_kN, ReactionMoments_kNm, SupportPosition, SumOfReactionForces_kN, SumOfReactionMoments_kNm

data_5 = Data(point_load)  # disabled
ggnode_2 = GgGSACreateOrFindNode(Location=data_5)  # disabled
vec_2 = Vector(expr("x/1000", Z))  # disabled
ggnl = GgGSALoadNode(LoadCase=gglc_2, LoadedNodes=ggnode_2, LoadDirectionAndMagnitude=vec_2, Units=1)  # disabled

model = ModelKaramba3D(analyze.CalculatedModel)  # disabled
react_2 = ReactionForcesKaramba3D(AnalyzedModel=model, LoadCase="0")  # -> AnalyzedModel, ReactionForces_kN, ReactionMoments_kNm, SupportPosition, SumOfReactionForces_kN, SumOfReactionMoments_kNm; disabled
vec_3 = Vector(react_2.ReactionForces_kN)  # disabled
ma = MassAddition(Input=vec_3)  # -> Result, PartialResults; disabled
vec_4 = Vector(expr("Round(x,2)", ma.Result))  # disabled
panel_19 = Panel(vec_4)  # disabled
devec = DeconstructVector(Vector=vec_3)  # -> XComponent, YComponent, ZComponent; disabled
bnd = Bounds(Numbers=devec.XComponent)  # disabled
bnd_2 = Bounds(Numbers=devec.YComponent)  # disabled
bnd_3 = Bounds(Numbers=devec.ZComponent)  # disabled
panel_20 = Panel(bnd_3)  # disabled
panel_21 = Panel(bnd_2)  # disabled
panel_22 = Panel(bnd)  # disabled

model_2 = ModelKaramba3D(analyze.CalculatedModel)  # disabled
react_3 = ReactionForcesKaramba3D(AnalyzedModel=model_2, LoadCase="0")  # -> AnalyzedModel, ReactionForces_kN, ReactionMoments_kNm, SupportPosition, SumOfReactionForces_kN, SumOfReactionMoments_kNm; disabled
vec_5 = Vector(react_3.ReactionMoments_kNm)  # disabled
ma_2 = MassAddition(Input=vec_5)  # -> Result, PartialResults; disabled
vec_6 = Vector(expr("Round(x,2)", ma_2.Result))  # disabled
panel_23 = Panel(vec_6)  # disabled
devec_2 = DeconstructVector(Vector=vec_5)  # -> XComponent, YComponent, ZComponent; disabled
bnd_4 = Bounds(Numbers=devec_2.XComponent)  # disabled
bnd_5 = Bounds(Numbers=devec_2.YComponent)  # disabled
bnd_6 = Bounds(Numbers=devec_2.ZComponent)  # disabled
panel_24 = Panel(bnd_6)  # disabled
panel_25 = Panel(bnd_5)  # disabled
panel_26 = Panel(bnd_4)  # disabled

model_3 = ModelKaramba3D(analyze.CalculatedModel)  # disabled
nodedisp = NodalDisplacementsKaramba3D(AnalyzedModel=model_3, LoadCase="0")  # -> AnalyzedModel, NodalTranslations_m, NodalRotations_rad; disabled
vec_7 = Vector(nodedisp.NodalTranslations_m)  # disabled
vlen = VectorLength(Vector=vec_7)  # disabled
devec_3 = DeconstructVector(Vector=vec_7)  # -> XComponent, YComponent, ZComponent; disabled
bnd_7 = Bounds(Numbers=devec_3.YComponent)  # disabled
bnd_8 = Bounds(Numbers=vlen)  # disabled
panel_27 = Panel(bnd_7)  # disabled
dedomain = DeconstructDomain(Domain=bnd_8)  # -> Start, End; disabled
multiplication = Multiplication(A=dedomain.End, B=1000)  # disabled
num_5 = Number(expr("Round(x,2)", multiplication))  # disabled
panel_28 = Panel(num_5)  # disabled

num_6 = Number(number_vibration_modes)  # disabled
model_4 = ModelKaramba3D(analyze.CalculatedModel)  # disabled
nvibes = NaturalVibrationsKaramba3D(Model=model_4, FromIndex=1, NumberOfModes=num_6, MaximumNumberOfIterations=30, Epsilon=1e-05)  # -> ModelWithVibrationModesAsLoadCaseResults, NaturalFrequencies_Hz, ModalMass_kg, ParticipationFactorInGlobalXYAndZDirection; disabled
panel_29 = Panel(nvibes.NaturalFrequencies_Hz)  # disabled

data_6 = Data(refine_2)
data_7 = Data(meter)
data_8 = Data(num)
data_9 = Data(v_poisson)
data_10 = Data(panel)
item_6 = ListItem(List=python.Gsa_AlpacaSupport, Index=0, Wrap=True)  # -> Item, Item1, Item2, Item3, Item4, Item5
data_11 = Data(support)
eim = ElasticIsotropicMaterialAlpaca4d(E=data_8, v=data_9, rho=data_10)  # -> out, nDMaterial
# ---------- eim: Python ----------
"""
Create a nD Elastic Isotropic Material
-
    Args:
        name:
        E:
        G:
        v:
        rho:
    Returns:
        nDMaterial:
"""

ghenv.Component.Name = "Elastic Isotropic Material (Alpaca4d)"
ghenv.Component.NickName = 'EIM'
ghenv.Component.Message = "Elastic Isotropic (Alpaca4d)"


import sys
import Rhino.Geometry as rg
import Grasshopper as gh
import copy


## add alpaca install directory to system path

ghcompfolder = gh.Folders.DefaultAssemblyFolder
if ghcompfolder not in sys.path:
    sys.path.append(ghcompfolder)

try:
    from Alpaca4d import alpaca4d as alpaca
except:
    msg = "Cannot import Alpaca4d. Is the Alpaca4d folder available in " + ghcompfolder + "?"
    ghenv.Component.AddRuntimeMessage(gh.Kernel.GH_RuntimeMessageLevel.Error, msg)


checkData = True

if not E:
    checkData = False
    msg = "Input parameter E failed to collect data"
    ghenv.Component.AddRuntimeMessage(gh.Kernel.GH_RuntimeMessageLevel.Warning, msg)

if not G and not v:
    checkData = False
    msg = "Input parameter G or v failed to collect data"
    ghenv.Component.AddRuntimeMessage(gh.Kernel.GH_RuntimeMessageLevel.Warning, msg)

if not rho:
    checkData = False
    msg = "Input parameter rho failed to collect data"
    ghenv.Component.AddRuntimeMessage(gh.Kernel.GH_RuntimeMessageLevel.Warning, msg)

if checkData:
    nDMaterial = alpaca.ElasticIsotropic(name, E, G, rho, v)
# ---------- end eim ----------
pfs = PlateFiberAlpaca4d(thickness=data_7, nDMaterial=eim.nDMaterial)  # -> out, Section
# ---------- pfs: Python ----------
"""
Create a Plate Fiber Section
-
    Args:
        secName:
        thickness:
        nDMaterial:
    Returns:
        Section:
"""


import sys
import Rhino.Geometry as rg
import Grasshopper as gh
import copy

ghenv.Component.Name = "Plate Fiber (Alpaca4d)"
ghenv.Component.NickName = 'PFS'
ghenv.Component.Message = "Plate Fiber (Alpaca4d)"


## add alpaca install directory to system path

ghcompfolder = gh.Folders.DefaultAssemblyFolder
if ghcompfolder not in sys.path:
    sys.path.append(ghcompfolder)

try:
    from Alpaca4d import alpaca4d as alpaca
except:
    msg = "Cannot import Alpaca4d. Is the Alpaca4d folder available in " + ghcompfolder + "?"
    ghenv.Component.AddRuntimeMessage(gh.Kernel.GH_RuntimeMessageLevel.Error, msg)


checkData = True

if not thickness:
    checkData = False
    msg = "Input parameter thickness failed to collect data"
    ghenv.Component.AddRuntimeMessage(gh.Kernel.GH_RuntimeMessageLevel.Warning, msg)

if not nDMaterial:
    checkData = False
    msg = "Input parameter nDMaterial failed to collect data"
    ghenv.Component.AddRuntimeMessage(gh.Kernel.GH_RuntimeMessageLevel.Warning, msg)

if checkData:
    Section = alpaca.PlateFiberSection(secName, thickness, nDMaterial)
# ---------- end pfs ----------
cts = ConstantTimeSeriesAlpaca4d()  # -> TimeSeries, Graph
# ---------- cts: Python ----------
"""
Create a Constant Time Series
-
    Args:
        tStart:
        tEnd:
        period:
        factor:
        shift:
    Returns:
        TimeSeries:
        Graph:
"""

ghenv.Component.Name = "Constant Time Series (Alpaca4d)"
ghenv.Component.NickName = 'CTS'
ghenv.Component.Message = "Constant Time Series (Alpaca4d)"


import sys
import Rhino.Geometry as rg
import Grasshopper as gh
import copy
import math


## add alpaca install directory to system path

ghcompfolder = gh.Folders.DefaultAssemblyFolder
if ghcompfolder not in sys.path:
    sys.path.append(ghcompfolder)

try:
    from Alpaca4d import alpaca4d as alpaca
except:
    msg = "Cannot import Alpaca4d. Is the Alpaca4d folder available in " + ghcompfolder + "?"
    ghenv.Component.AddRuntimeMessage(gh.Kernel.GH_RuntimeMessageLevel.Error, msg)

def ConstantSeries(x):
    return x



checkData = True

if not constantFactor:
    constantFactor = 1


if checkData:
    TimeSeries = alpaca.TimeSeriesConstant(constantFactor)
    
    Graph = []
    
    for x in range(10):
        Graph.append(ConstantSeries(constantFactor))
# ---------- end cts ----------
pl = PointLoadAlpaca4d(Pos=data_2, Force=data_3, TimeSeries=cts.TimeSeries)  # -> out, flatten(Load); inputs Pos: Point3d, Force: Vector3d, Moment: Vector3d
# ---------- pl: Python ----------
"""
Create a Point Load
-
    Args:
        Pos:
        Force:
        Moment:
        TimeSeries:
    Returns:
        PointLoad:
"""

ghenv.Component.Name = "Point Load (Alpaca4d)"
ghenv.Component.NickName = 'PL'
ghenv.Component.Message = "Point Load (Alpaca4d)"



import sys
import Rhino.Geometry as rg
import Grasshopper as gh
import copy


## add alpaca install directory to system path

ghcompfolder = gh.Folders.DefaultAssemblyFolder
if ghcompfolder not in sys.path:
    sys.path.append(ghcompfolder)

try:
    from Alpaca4d import alpaca4d as alpaca
except:
    msg = "Cannot import Alpaca4d. Is the Alpaca4d folder available in " + ghcompfolder + "?"
    ghenv.Component.AddRuntimeMessage(gh.Kernel.GH_RuntimeMessageLevel.Error, msg)


checkData = True

if not Pos:
    checkData = False
    msg = "Input parameter Pos failed to collect data"
    ghenv.Component.AddRuntimeMessage(gh.Kernel.GH_RuntimeMessageLevel.Warning, msg)

if not Force:
    Force = rg.Vector3d(0,0,0)

if not Moment:
    Moment = rg.Vector3d(0,0,0)

if not TimeSeries:
    checkData = False
    msg = "Input parameter TimeSeries failed to collect data"
    ghenv.Component.AddRuntimeMessage(gh.Kernel.GH_RuntimeMessageLevel.Warning, msg)


if checkData:
    Load = alpaca.PointLoad(Pos, Force, Moment, TimeSeries)
# ---------- end pl ----------
support_2 = SupportAlpaca4d(Pos=data_11, Tx=item_6.Item, Ty=item_6.Item1, Tz=item_6.Item2, Rx=item_6.Item3, Ry=item_6.Item4, Rz=item_6.Item5)  # -> Support; inputs Pos: Point3d, Tx: Boolean, Ty: Boolean, Tz: Boolean, Rx: Boolean, Ry: Boolean, Rz: Boolean
# ---------- support_2: Python ----------
"""
Create a support
-
    Args:
        Pos:
        Tx:
        Ty:
        Tz:
        Rx:
        Ry:
    Returns:
        Support:
"""

ghenv.Component.Name = "Support (Alpaca4d)"
ghenv.Component.NickName = 'Support'
ghenv.Component.Message = "Support (Alpaca4d)"


import sys
import Rhino.Geometry as rg
import Grasshopper as gh


## add alpaca install directory to system path

ghcompfolder = gh.Folders.DefaultAssemblyFolder
if ghcompfolder not in sys.path:
    sys.path.append(ghcompfolder)

try:
    from Alpaca4d import alpaca4d as alpaca
except:
    msg = "Cannot import Alpaca4d. Is the Alpaca4d folder available in " + ghcompfolder + "?"
    ghenv.Component.AddRuntimeMessage(gh.Kernel.GH_RuntimeMessageLevel.Error, msg)

checkData = True


if not Pos:
    checkData = False
    msg = "Input parameter Pos failed to collect data"
    ghenv.Component.AddRuntimeMessage(gh.Kernel.GH_RuntimeMessageLevel.Warning, msg)

if checkData:
    Support = alpaca.Support(Pos, Tx, Ty, Tz, Rx, Ry, Rz)
# ---------- end support_2 ----------
as = AnalysesStepsAlpaca4d(numIncr="1")  # -> AnalysisSteps; inputs numIncr: Int32
# ---------- as: Python ----------
"""
Define the Analysis Step
-
    Inputs:
        numIncr:
        dt:
        dtMin:
        dtMAx:
        Jd:
    Output:
        AnalysisSteps:
"""



ghenv.Component.Name = "Analyses Steps (Alpaca4d)"
ghenv.Component.NickName = 'AS'
ghenv.Component.Message = "Analyses Steps (Alpaca4d)"
ghenv.Component.IconDisplayMode = ghenv.Component.IconDisplayMode.application
ghenv.Component.Category = "Alpaca4d"
ghenv.Component.SubCategory = "7_Analysis"



import sys
import Rhino.Geometry as rg
import Grasshopper as gh
import ghpythonlib.components as ghcomp
from System.Drawing import Color

## add alpaca install directory to system path

ghcompfolder = gh.Folders.DefaultAssemblyFolder
if ghcompfolder not in sys.path:
    sys.path.append(ghcompfolder)

try:
    from Alpaca4d import alpaca4d as alpaca
except:
    msg = "Cannot import Alpaca4d. Is the Alpaca4d folder available in " + ghcompfolder + "?"
    ghenv.Component.AddRuntimeMessage(gh.Kernel.GH_RuntimeMessageLevel.Error, msg)

dt = "" if dt is None else dt
dtMin = "" if dtMin is None else dtMin
dtMax = "" if dtMax is None else dtMax
Jd = "" if Jd is None else Jd

checkData = True

if not numIncr:
    checkData = False
    msg = "Input parameter numIncr failed to collect data"
    ghenv.Component.AddRuntimeMessage(gh.Kernel.GH_RuntimeMessageLevel.Warning, msg)

if checkData:
    AnalysisSteps = alpaca.AnalysisSteps(numIncr, dt, dtMin, dtMax, Jd)
# ---------- end as ----------
as_2 = AnalysisSettingsAlpaca4d(AnalysisSteps=as)  # -> Settings
# ---------- as_2: Python ----------
"""
Create Analysis settings
-
    Args:
        Constraint: 'Plain', 'Transformation'. Default is 'Transformation'.
        Numberer: 'RCM', 'AMD', 'Plain'. Default is 'RCM'.
        System: 'BandGen', 'BandSPD', 'ProfileSPD', 'SuperLU', 'UmfPack', 'FullGeneral', 'SparseSYM'. Default is 'BandSPD'.
        Test: Feature not implemented. Please contact alpaca4d@gmail.com 
        Algorithm: 'Linear', 'Newton', 'NewtonLineSearch', 'ModifiedNewton', 'KrylovNewton', 'SecantNewton', 'BFGS', 'Broyden'. Default is 'Linear'.
        Integrator: Default is LoadControl.
        AnalysisType: 'Static', 'Transient'. Default is 'Static'.
        AnalyesSteps:
    Returns:
        Analysis:
"""

import sys
import os


import clr
import clrtype
import Rhino.Geometry as rg
import rhinoscriptsyntax as rs
import Grasshopper as gh
import copy
import ghpythonlib.treehelpers as th


ghenv.Component.Name = "Analysis settings (Alpaca4d)"
ghenv.Component.NickName = 'AS'
ghenv.Component.Message = "Analysis settings \n(Alpaca4d)"



from Alpaca4d import alpaca4d as alpaca

checkData = True


# default Value
Constraint = 'Transformation' if Constraint is None else Constraint
ConstraintList = ['Plain', 'Transformation']

for item in ConstraintList:
    if Constraint.lower() == item.lower():
        print(item)
        Constraint = item


# default Value
Numberer = 'RCM' if Numberer is None else Numberer
NumbererList = ['RCM', 'AMD', 'Plain', 'ParallelPlain', 'ParallelRCM']

for i,item in enumerate(NumbererList):
    if Numberer.lower() == item.lower():
        Numberer = item



# default Value
System = 'BandSPD' if System is None else System
SystemList = ['BandGen', 'BandSPD', 'ProfileSPD', 'SuperLU', 'UmfPack', 'FullGeneral', 'SparseSYM']

for i,item in enumerate(SystemList):
    if System.lower() == item.lower():
        System = item


# default Test
Test = 'NormDispIncr 1.0e-6 12 5' if Test is None else Test




# default Value
Algorithm = 'Linear' if Algorithm is None else Algorithm
AlgorithmList = ['Linear', 'Newton', 'NewtonLineSearch', 'ModifiedNewton', 'KrylovNewton', 'SecantNewton', 'BFGS', 'Broyden']

for i,item in enumerate(AlgorithmList):
    if Algorithm.lower() == item.lower():
        Algorithm = item


# default Value
AnalysisType = 'Static' if AnalysisType is None else AnalysisType
AnalysisTypeList = ['Static', 'Transient']

for item in AnalysisTypeList:
    if AnalysisType.lower() == item.lower():
        AnalysisType = item


## Define Integrator
if AnalysisType == "Static":
    Integrator = "LoadControl 1.0" if Integrator is None else Integrator
elif AnalysisType == "Transient":
    Integrator = "Newmark 0.5 0.25" if Integrator is None else Integrator



if not AnalysisSteps:
    checkData = False
    msg = "Input parameter AnalysisSteps failed to collect data"
    ghenv.Component.AddRuntimeMessage(gh.Kernel.GH_RuntimeMessageLevel.Warning, msg)


if checkData:
    Settings = alpaca.Analysis(Constraint, Numberer,System,Test,Algorithm,Integrator,AnalysisType, AnalysisSteps)
    print(Settings.write_tcl())
# ---------- end as_2 ----------

dots = DotDisplay(Point=data_11, Colour=RGB(0, 0, 0), Size="0.1")
mitc4 = ShellMITC4Alpaca4d(Mesh=data_6, Section=pfs.Section)  # -> out, Element; inputs Mesh: Mesh, Colour: Color
# ---------- mitc4: Python ----------
"""
Create a ShellMITC4 element
-
    Args:
        Mesh:
        Section:
        Colour:
    Returns:
        Element:
"""

ghenv.Component.Name = "Shell MITC4 (Alpaca4d)"
ghenv.Component.NickName = 'MITC4'
ghenv.Component.Message = "ShellMITC4 (Alpaca4d)"
ghenv.Component.IconDisplayMode = ghenv.Component.IconDisplayMode.application
ghenv.Component.Category = "Alpaca4d"
ghenv.Component.SubCategory = "2_Element"



import sys
import Rhino.Geometry as rg
import Grasshopper as gh
from System.Drawing import Color


## add alpaca install directory to system path

ghcompfolder = gh.Folders.DefaultAssemblyFolder
if ghcompfolder not in sys.path:
    sys.path.append(ghcompfolder)

try:
    from Alpaca4d import alpaca4d as alpaca
except:
    msg = "Cannot import Alpaca4d. Is the Alpaca4d folder available in " + ghcompfolder + "?"
    ghenv.Component.AddRuntimeMessage(gh.Kernel.GH_RuntimeMessageLevel.Error, msg)


checkData = True

if not Mesh:
    checkData = False
    msg = "Input parameter Mesh failed to collect data"
    ghenv.Component.AddRuntimeMessage(gh.Kernel.GH_RuntimeMessageLevel.Warning, msg)

if not Section:
    checkData = False
    msg = "Input parameter Section failed to collect data"
    ghenv.Component.AddRuntimeMessage(gh.Kernel.GH_RuntimeMessageLevel.Warning, msg)

if not Colour:
    Colour = Color.Blue


if checkData:
    
    Mesh.Unweld(0,True)
    explodedMesh = Mesh.ExplodeAtUnweldedEdges()
    if explodedMesh.Length > 0:
        Element = []
        for mesh in explodedMesh:
            if mesh.Vertices.Count == 4:
                Element.append(alpaca.ShellMITC4(mesh, Section, Colour))
            elif mesh.Vertices.Count == 3:
                Element.append(alpaca.ShellNLDKGT(mesh, Section, Colour))
    elif explodedMesh.Length == 0:
        if Mesh.Vertices.Count == 4:
                Element = alpaca.ShellMITC4(Mesh, Section, Colour)
        elif Mesh.Vertices.Count == 3:
            Element = alpaca.ShellNLDKGT(Mesh, Section, Colour)
# ---------- end mitc4 ----------
demesh_2 = DeconstructMesh(Mesh=data_6)  # -> Vertices, Faces, Colours, Normals
am = AssembleModelAlpaca4d(Element=flatten(mitc4.Element), Support=support_2, Load=pl.Load)  # -> out, AlpacaModel, Mass, uniqueCS, uniqueMaterial, text; inputs Element: list, Support: list, Load: list, Constraint: list
# ---------- am: Python ----------
"""
Create a FEA Model
-
    Args:
        Element:
        Support:
        Load:
        Constraint:
    Returns:
        AlpacaModel:
"""


import os
import sys
import ghpythonlib.treehelpers as th
import Rhino.Geometry as rg
import Rhino.Collections as rc
import rhinoscriptsyntax as rs
from collections import defaultdict, OrderedDict
import copy
import time
import Grasshopper as gh


ghenv.Component.Name = "Assemble Model (Alpaca4d)"
ghenv.Component.NickName = 'AM'
ghenv.Component.Message = "Assemble Model (Alpaca4d)"


## add alpaca install directory to system path

ghcompfolder = gh.Folders.DefaultAssemblyFolder
if ghcompfolder not in sys.path:
    sys.path.append(ghcompfolder)

try:
    from Alpaca4d import alpaca4d as alpaca
except:
    msg = "Cannot import Alpaca4d. Is the Alpaca4d folder available in " + ghcompfolder + "?"
    ghenv.Component.AddRuntimeMessage(gh.Kernel.GH_RuntimeMessageLevel.Error, msg)


checkData = True

if not Element:
    checkData = False
    msg = "Input parameter Element failed to collect data"
    ghenv.Component.AddRuntimeMessage(gh.Kernel.GH_RuntimeMessageLevel.Warning, msg)

if not Support:
    checkData = False
    msg = "Input parameter Support failed to collect data"
    ghenv.Component.AddRuntimeMessage(gh.Kernel.GH_RuntimeMessageLevel.Warning, msg)


if checkData:
    
    FolderPath = rs.DocumentPath()
    os.chdir(FolderPath)
    
    # create the object model
    AlpacaModel = alpaca.Model()
    
    
    start = time.clock()
    #subdivide element per type
    
    for element in Element:
        if element.type == "Beam":
            AlpacaModel.beams.append(element)
        elif element.type == "Shell":
            AlpacaModel.shells.append(element)
        elif element.type == "Brick":
            AlpacaModel.bricks.append(element)
    
    
    end = time.clock() - start
    print("time to subdivide element {}".format(end))
    start = time.clock()
    
    # create a list of unique point
    # need to add the rigid constraint
    
    AlpacaModel.getuniquePoints(AlpacaModel.beams, AlpacaModel.shells, AlpacaModel.bricks, Constraint)
    
    
    end = time.clock() - start
    print("time to get uniquepoints {}".format(end))
    start = time.clock()
    
    
    #############
    # create node and assign to object
    #############
    
    if AlpacaModel.uniquePointsThreeNDF:
        AlpacaModel.py.append(alpaca.Model.write3ndf_tcl())
        for point in AlpacaModel.uniquePointsThreeNDF:
            node = alpaca.Node(point)
            node.ndf = 3
            node.setNodeTag(AlpacaModel)
            AlpacaModel.nodes.append( node )
        
            AlpacaModel.py.append(node.write_tcl())
    
    
    if AlpacaModel.uniquePointsSixNDF:
        AlpacaModel.py.append(alpaca.Model.write6ndf_tcl())
        for point in AlpacaModel.uniquePointsSixNDF:
            node = alpaca.Node(point)
            node.ndf = 6
            node.setNodeTag(AlpacaModel)
            AlpacaModel.nodes.append( node )
         
            AlpacaModel.py.append(node.write_tcl())
    
    
    
    end = time.clock() - start
    print("time to create node and assign tag {}".format(end))
    start = time.clock()
    
    
    #################
    # create supports
    #################
    
    for supportNode in Support:
        
        # if the list is empty, skip this operation
        if AlpacaModel.uniquePointsThreeNDF:
            closestPointInThreeNDF = rc.Point3dList.ClosestPointInList(AlpacaModel.uniquePointsThreeNDF, supportNode.Pos)
            if supportNode.Pos.DistanceTo(closestPointInThreeNDF) < 0.001:
                #print("I am in 3ndf")
                supportNode.ndf = 3
                AlpacaModel.threeNDFModel.append(supportNode)
                supportNode.setNodeTag(AlpacaModel)
        
        if AlpacaModel.uniquePointsSixNDF:
            closestPointInSixNDF = rc.Point3dList.ClosestPointInList(AlpacaModel.uniquePointsSixNDF, supportNode.Pos)
            if supportNode.Pos.DistanceTo(closestPointInSixNDF) < 0.001:
                supportNode.ndf = 6
                AlpacaModel.sixNDFModel.append(supportNode)
                supportNode.setNodeTag(AlpacaModel)
        
        
        AlpacaModel.supports.append(supportNode)
        AlpacaModel.py.append(supportNode.write_tcl())
    
    
    end = time.clock() - start
    print("time to create support and assign tag {}".format(end))
    start = time.clock()
    
    
    ####################
    # create constraints
    ####################
    
    
    for constraint in Constraint:
        constraint.setNodeTag(AlpacaModel)
        AlpacaModel.constraints.append(constraint)
    
    ####################
    # create equalDOF when the model has 3df and 6df together
    ####################
    
    
    end = time.clock() - start
    print("time to create constraint and assign tag {}".format(end))
    start = time.clock()
    
    
    Id = []
    IdB = []
    
    def SearchCallback(sender, e):
        Id.Add(e.Id)
        IdB.Add(e.IdB)
    
    
    
    lenThreeNDF = len(AlpacaModel.uniquePointsThreeNDF)
    lenSixNDF = len(AlpacaModel.uniquePointsSixNDF)
    
    
    if not(lenThreeNDF == 0 or lenSixNDF == 0):
        print("brick and beam together")
        rg.RTree.SearchOverlaps(AlpacaModel.RTreeCloudPointThreeNDF, AlpacaModel.RTreeCloudPointSixNDF, 0.001, SearchCallback)
        
        for i,j in zip(Id, IdB):
            print(i,j)
            node_i = AlpacaModel.uniquePointsThreeNDF[i]
            node_j = AlpacaModel.uniquePointsSixNDF[j]
            
            #index_i = AlpacaModel.cloudPoint.ClosestPoint(node_i) + 1
            #index_j = AlpacaModel.cloudPoint.ClosestPoint(node_j) + 1
            
            equalConstraint = alpaca.EqualDOF(node_i, node_j, True, True, True, False, False, False)
            equalConstraint.masterNodeTag = AlpacaModel.cloudPointThreeNDF.ClosestPoint(node_i) + 1
            equalConstraint.slaveNodesTag = AlpacaModel.cloudPointSixNDF.ClosestPoint(node_j) + 1 + len(AlpacaModel.uniquePointsThreeNDF)
            AlpacaModel.py.append(equalConstraint.write_tcl())
    
    
    
    end = time.clock() - start
    print("time to find common points between 3ndf and 6ndf {}".format(end))
    start = time.clock()
    
    ##########################
    ##########################
    ##########################
    
    crossSection = []
    material = []
    
    for item in Element:
        crossSection.append(item.CrossSection)
        material.append(item.CrossSection.material)
    
    uniqueCS = list(set(crossSection))
    uniqueMaterial = list(set(material))
    
    for index, material in enumerate(uniqueMaterial,1):
        material.matTag = index
        AlpacaModel.py.append(material.write_tcl())
    
    
    for index, section in enumerate(uniqueCS,1):
        section.sectionTag = index
        AlpacaModel.py.append(section.write_tcl())
        
    
    
    
    
    
    # write py file
    
    
    # assign tag and node Index to element and shell
    for index, element in enumerate(Element,1):
        element.setTopologyRTree(AlpacaModel)
        element.eleTag = index
        element.setTags()
    
    
    
    end = time.clock() - start
    print("time to assign tags for the elements {}".format(end))
    start = time.clock()
    
    
    
    Mass = 0
    IsGravity = False
    
    for item in Load:
        if item.type == "Gravity Load":
            IsGravity = True
            GravityLoad = item
        if item.type == "PointLoad":
            AlpacaModel.loads.append(item)
    
    
    for item in Element:
        if item.type == "Beam":
            length = item.Crv.GetLength()
            Mass += (item.massDens * length)
            if IsGravity:
                gravityPointLoad = alpaca.PointLoad(item.Crv.PointAtStart, rg.Vector3d(0,0, -(item.massDens * length / 2)) * GravityLoad.GravityFactor, rg.Vector3d(0,0,0), GravityLoad.TimeSeries)
                #print( -(item.massDens * length / 2))
                AlpacaModel.loads.append(gravityPointLoad)
        if item.type == "Shell":
            meshArea = rg.AreaMassProperties.Compute(item.Mesh).Area
            areaDensity = item.CrossSection.thickness * item.CrossSection.material.rho
            Mass += areaDensity * meshArea
            if IsGravity:
                for vertex in item.Mesh.Vertices.ToPoint3dArray():
                    gravityPointLoad = alpaca.PointLoad(vertex, rg.Vector3d(0,0, -(areaDensity * meshArea/ len(item.Mesh.Vertices))) * GravityLoad.GravityFactor, rg.Vector3d(0,0,0), GravityLoad.TimeSeries)
                    AlpacaModel.loads.append(gravityPointLoad)
        if item.type == "Brick":
            #print(type(item.Mesh))
            meshVolume = rg.VolumeMassProperties.Compute(item.Mesh).Volume
            density = item.material.rho 
            Mass += density * meshVolume
            if IsGravity:
                for vertex in item.Mesh.Vertices.ToPoint3dArray():
                    gravityPointLoad = alpaca.PointLoad(vertex, rg.Vector3d(0,0, -(density * meshVolume / len(item.Mesh.Vertices))) * GravityLoad.GravityFactor, rg.Vector3d(0,0,0), GravityLoad.TimeSeries)
                    #print(len(item.Mesh.Vertices))
                    #print(density)
                    # volume can be zero if mesh faces are not properly rotated
                    #print(meshVolume)
                    #print(-(density * meshVolume / len(item.Mesh.Vertices)))
                    AlpacaModel.loads.append(gravityPointLoad)
    
    #print(AlpacaModel.loads)
    ## load
    
    
    for item in AlpacaModel.loads:
        item.setNodeTag(AlpacaModel)
    
    #print(AlpacaModel.loads)
    
    for item in AlpacaModel.beams:
        AlpacaModel.py.append(item.write_tcl())
    
    for item in AlpacaModel.shells:
        AlpacaModel.py.append(item.write_tcl())
    
    for item in AlpacaModel.bricks:
        AlpacaModel.py.append(item.write_tcl())
    
    
    for item in Constraint:
        AlpacaModel.py.append(item.write_tcl())
    
    
    timeSeriesDict = alpaca.TimeSeries.getTimeSeries(AlpacaModel.loads)[1]
    AlpacaModel.py.append(alpaca.PointLoad.write_tcl(timeSeriesDict,AlpacaModel))
    
    
    text = AlpacaModel.py
# ---------- end am ----------
lng = ListLength(List=demesh_2.Vertices)
panel_30 = Panel(lng)
ra = RunAnalysisAlpaca4d(AlpacaModel=am.AlpacaModel, Settings=as_2)  # -> log, AlpacaSolvedModel
# ---------- ra: Python ----------
"""
Run an OpenSees Analysis
-
    Args:
        AlpacaModel:
        Settings:
    Returns:
        AlpacaSolvedModel:
"""



import Rhino.RhinoDoc
import Grasshopper as gh
import copy
import rhinoscriptsyntax as rs
import os
import time
import sys
import Rhino

Rhino.Runtime.HostUtils.DisplayOleAlerts(False)


ghenv.Component.Name = "Run Analysis (Alpaca4d)"
ghenv.Component.NickName = 'RA'
ghenv.Component.Message = "Run Analysis (Alpaca4d)"

ghcompfolder = gh.Folders.DefaultAssemblyFolder
if ghcompfolder not in sys.path:
    sys.path.append(ghcompfolder)

try:
    from Alpaca4d import alpaca4d as alpaca
except:
    msg = "Cannot import Alpaca4d. Is the Alpaca4d folder available in " + ghcompfolder + "?"
    ghenv.Component.AddRuntimeMessage(gh.Kernel.GH_RuntimeMessageLevel.Error, msg)


checkData = True



if not AlpacaModel:
    checkData = False
    msg = "Input parameter AlpacaModel failed to collect data"
    ghenv.Component.AddRuntimeMessage(gh.Kernel.GH_RuntimeMessageLevel.Warning, msg)


if not Settings:
    checkData = False
    msg = "Input parameter Settings failed to collect data"
    ghenv.Component.AddRuntimeMessage(gh.Kernel.GH_RuntimeMessageLevel.Warning, msg)


if checkData:
    FolderPath = rs.DocumentPath()
    os.chdir(FolderPath)
    
    outputFileName = 'openSeesModel'
    recorderFileName = 'recorder.mpco'
    
    for dirpath, dirnames, filenames in os.walk(FolderPath):
        for filename in filenames:
            if filename == outputFileName:
                file = os.path.join(dirpath,outputFileName)
                os.remove(file)
            elif filename == recorderFileName:
                file = os.path.join(dirpath,recorderFileName)
                os.remove(file)
    
    
    # create a copy
    
    AnalysisModel = copy.copy(AlpacaModel)
    AnalysisModel.py = list(AnalysisModel.py)
    
    # generate Recorder and assign name
    AnalysisModel.recorderName = "recorder" + ".mpco"
    
    AnalysisModel.py.append(alpaca.TCLRecorder.mpco(AnalysisModel.recorderName, True,True,True,True,False,False,True,True,True,True))
    
    
    AnalysisModel.analysis = Settings
    AnalysisModel.py.append(Settings.write_tcl())
    AnalysisModel.py.append("wipe")
    
    
    #textFile = AnalysisModel.py
    
    time_start = time.clock()
    
    AnalysisModel.writeFile(outputFileName)
    
    time_elapsed = (time.clock() - time_start)
    print("Writing Time {}".format(time_elapsed))
    
    
    
    time_start = time.clock()
    
    executable = os.path.join(ghcompfolder,'Alpaca4d\OpenSees-Solvers\opensees.bat')
    a, log = AnalysisModel.runOpensees(executable)
    
    
    time_elapsed = (time.clock() - time_start)
    print("Analyses Time {}".format(time_elapsed))
    
    AlpacaSolvedModel = copy.copy(AnalysisModel)
    AlpacaSolvedModel.isAnalysed = True
# ---------- end ra ----------

ra_2 = RunAnalysisAlpaca4d(AlpacaModel=am.AlpacaModel, Settings=as_2)  # -> log, AlpacaSolvedModel; disabled
# ---------- ra_2: Python ----------
"""
Run an OpenSees Analysis
-
    Args:
        AlpacaModel:
        Settings:
    Returns:
        AlpacaSolvedModel:
"""



import Rhino.RhinoDoc
import Grasshopper as gh
import copy
import rhinoscriptsyntax as rs
import os
import time
import sys



ghenv.Component.Name = "Run Analysis (Alpaca4d)"
ghenv.Component.NickName = 'RA'
ghenv.Component.Message = "Run Analysis (Alpaca4d)"

ghcompfolder = gh.Folders.DefaultAssemblyFolder
if ghcompfolder not in sys.path:
    sys.path.append(ghcompfolder)

try:
    from Alpaca4d import alpaca4d as alpaca
except:
    msg = "Cannot import Alpaca4d. Is the Alpaca4d folder available in " + ghcompfolder + "?"
    ghenv.Component.AddRuntimeMessage(gh.Kernel.GH_RuntimeMessageLevel.Error, msg)


checkData = True



if not AlpacaModel:
    checkData = False
    msg = "Input parameter AlpacaModel failed to collect data"
    ghenv.Component.AddRuntimeMessage(gh.Kernel.GH_RuntimeMessageLevel.Warning, msg)


if not Settings:
    checkData = False
    msg = "Input parameter Settings failed to collect data"
    ghenv.Component.AddRuntimeMessage(gh.Kernel.GH_RuntimeMessageLevel.Warning, msg)


if checkData:
    FolderPath = rs.DocumentPath()
    os.chdir(FolderPath)
    
    outputFileName = 'openSeesModel'
    recorderFileName = 'recorder.mpco'
    
    for dirpath, dirnames, filenames in os.walk(FolderPath):
        for filename in filenames:
            if filename == outputFileName:
                file = os.path.join(dirpath,outputFileName)
                os.remove(file)
            elif filename == recorderFileName:
                file = os.path.join(dirpath,recorderFileName)
                os.remove(file)
    
    
    # create a copy
    
    AnalysisModel = copy.copy(AlpacaModel)
    AnalysisModel.py = list(AnalysisModel.py)
    
    # generate Recorder and assign name
    AnalysisModel.recorderName = "recorder" + ".mpco"
    
    AnalysisModel.py.append(alpaca.TCLRecorder.mpco(AnalysisModel.recorderName, True,True,True,True,False,False,True,True,True,True))
    
    
    AnalysisModel.analysis = Settings
    AnalysisModel.py.append(Settings.write_tcl())
    AnalysisModel.py.append("wipe")
    
    
    #textFile = AnalysisModel.py
    
    time_start = time.clock()
    
    AnalysisModel.writeFile(outputFileName)
    
    time_elapsed = (time.clock() - time_start)
    print("Writing Time {}".format(time_elapsed))
    
    
    
    time_start = time.clock()
    
    executable = os.path.join(ghcompfolder,'Alpaca4d\OpenSees-Solvers\opensees.bat')
    a, log = AnalysisModel.runOpensees(executable)
    
    
    time_elapsed = (time.clock() - time_start)
    print("Analyses Time {}".format(time_elapsed))
    
    AlpacaSolvedModel = copy.copy(AnalysisModel)
    AlpacaSolvedModel.isAnalysed = True
# ---------- end ra_2 ----------
panel_31 = Panel(ra_2.log)
dm = DeformedModelAlpaca4d(AlpacaSolvedModel=ra.AlpacaSolvedModel, scale=deformed_factor, listColor=clr)  # -> DefModel, bounds; inputs step: Int32, extrudeModel: Boolean, typeColor: Int32, listColor: list of Color
# ---------- dm: Python ----------
"""View Deformed model
    Args:
        AlpacaSolvedModel: Output of Analyses solver
        step:
        scale: Multiplication factor for displacement
        extrudeModel:  
True : view extruded model
else : view stick model
        typeColor:  View relative color of the traslation
<=0 : view traslation X 
1 : view traslation Y
2 : view traslation Z
>= 3 : view resulting displacement.
        listColor : one list of color 

    Output:
       DefModel: view deformed model
       bounds: max end min of displacement of the structure 
"""

ghenv.Component.Name = "Deformed Model (Alpaca4d)"
ghenv.Component.NickName = 'DM'
ghenv.Component.Message = "Deformed Model (Alpaca4d)"

from ghpythonlib.componentbase import executingcomponent as component
import System
import rhinoscriptsyntax as rs

import sys
import os
import clr
import clrtype
import Rhino.Geometry as rg
import Rhino as rc
import math as mt
import Grasshopper as gh
import ghpythonlib.treehelpers as th
from ghpythonlib.components import ConstructDomain

ghcompfolder = gh.Folders.DefaultAssemblyFolder
if ghcompfolder not in sys.path:
    sys.path.append(ghcompfolder)
try:
    from Alpaca4d import alpaca4dView as alpacaView
except:
    msg = "Cannot import Alpaca4d. Is the Alpaca4d folder available in " + ghcompfolder + "?"
    ghenv.Component.AddRuntimeMessage(gh.Kernel.GH_RuntimeMessageLevel.Error, msg)
    
FolderPath = rs.DocumentPath()
os.chdir(FolderPath)

ghcompfolder = gh.Folders.DefaultAssemblyFolder
my_module_name = "Alpaca_StepReader"
my_module = sys.modules.setdefault(my_module_name, type(sys)(my_module_name))


try:
    Steps_dm = my_module.Steps_dm
    Modes = my_module.Modes
except AttributeError:
    type_2d = type(System.Array.CreateInstance(float, 1, 1))

    class Steps_dm(object):
        __metaclass__ = clrtype.ClrClass
        _clrfields = {"STEP_{}".format(i): type_2d for i in range(1000)} # it will work for model with less than 1000 steps

    class Modes(object):
        __metaclass__ = clrtype.ClrClass
        _clrfields = {"MODE_{}".format(i): type_2d for i in range(1000)} # it will work for model with less than 1000 steps

    my_module.Steps_dm = Steps_dm
    my_module.Modes = Modes


hdfFilePath = os.path.join(ghcompfolder, "Alpaca4d\HDF5CSharp.dll")
clr.AddReferenceToFileAndPath(hdfFilePath)

from HDF5CSharp import Hdf5

class MyComponent(component):
    
    def RunScript(self, AlpacaSolvedModel, step = None, scale = None , extrudeModel = None, typeColor = None, listColor = [] ):
        import sys
        
        self.extrudeModel = extrudeModel
        
        self.defModel1 = []
        self.defModel2 = []
        self.defModel3 = []
        
        self.beamColor = []
        

        if step == None:
            step = 0
        if extrudeModel == None:
            extrudeModel = False
        if typeColor == None:
            typeColor = 3
        
        if not listColor: listColor = [ System.Drawing.Color.DarkViolet, 
                                        System.Drawing.Color.BlueViolet, 
                                        System.Drawing.Color.RoyalBlue, 
                                        System.Drawing.Color.CornflowerBlue,
                                        System.Drawing.Color.LightSkyBlue, 
                                        System.Drawing.Color.LightBlue,
                                        System.Drawing.Color.CadetBlue,
                                        System.Drawing.Color.LightGreen,
                                        System.Drawing.Color.GreenYellow,
                                        System.Drawing.Color.Yellow,
                                        System.Drawing.Color.Orange,
                                        System.Drawing.Color.Red,
                                        System.Drawing.Color.DarkRed]
            
        checkData = True
        
        if not AlpacaSolvedModel:
            checkData = False
            msg = "Input parameter AlpacaSolvedModel failed to collect data"
            ghenv.Component.AddRuntimeMessage(gh.Kernel.GH_RuntimeMessageLevel.Warning, msg)
        else:
            try:
                fileId = Hdf5.OpenFile(AlpacaSolvedModel.recorderName, True)
                print( AlpacaSolvedModel.recorderName)
                numberOfPoints = len(AlpacaSolvedModel.uniquePoints) #
                
                displacement = []
                rotation = []
                dispNodeList = []
                
                if AlpacaSolvedModel.isModal == True:
                    print( AlpacaSolvedModel.isModal == True )
                    outputData = "MODEL_STAGE[1]/RESULTS/ON_NODES/MODES_OF_VIBRATION(U)/DATA/STEP_0"
                    print( outputData )
                    displacementResult = Hdf5.ReadObject[Modes](fileId, outputData)
                    for i in range(numberOfPoints):
                        tag = i + 1
                        vx = getattr(displacementResult, 'MODE_{}'.format(step))[i,0]
                        vy = getattr(displacementResult, 'MODE_{}'.format(step))[i,1]
                        vz = getattr(displacementResult, 'MODE_{}'.format(step))[i,2]
                        trasl = rg.Vector3d(vx,vy,vz)
                        displacement.append(trasl)
                        dispNodeList.append( [tag, trasl] )
                        
                    Hdf5.CloseFile(fileId)
                    print("I have closed the file")
                else: 
                    outputData = "/MODEL_STAGE[1]/RESULTS/ON_NODES/DISPLACEMENT/DATA"
                    print( outputData )
                    displacementResult = Hdf5.ReadObject[Steps_dm](fileId, outputData)
                    for i in range(numberOfPoints):
                        tag = i + 1
                        vx = getattr(displacementResult, 'STEP_{}'.format(step))[i,0]
                        vy = getattr(displacementResult, 'STEP_{}'.format(step))[i,1]
                        vz = getattr(displacementResult, 'STEP_{}'.format(step))[i,2]
                        trasl = rg.Vector3d(vx,vy,vz)
                        displacement.append(trasl)
                        dispNodeList.append( [tag, trasl] )
                        
                    Hdf5.CloseFile(fileId)
                    print("I have closed the file")
            
                dispNodeDict = dict( dispNodeList )
                #---------------------------------------------------#
                defEleVector1 = alpacaView.BeamVectorDef(AlpacaSolvedModel,dispNodeDict) #beam
                defEleVector2 = alpacaView.ShellVectorDef(AlpacaSolvedModel,dispNodeDict) #shell
                defEleVector3 = alpacaView.BrickVectorDef(AlpacaSolvedModel,dispNodeDict) #shell
                bound = alpacaView.boundsDef(displacement, typeColor)
                if scale == None: scale = 1/bound[1]
                if self.extrudeModel == None or self.extrudeModel == False:
                    #BEAM
                    defModel1 = alpacaView.BeamDef(AlpacaSolvedModel, dispNodeDict,scale)
                    self.defModel1, self.beamColor = alpacaView.ColorBeamDef( defModel1, defEleVector1, bound, listColor, typeColor)
                    #SHELL
                    defModel2 = alpacaView.ShellDef(AlpacaSolvedModel,dispNodeDict,scale)
                    #BRICK
                    defModel3 = alpacaView.BrickDef(AlpacaSolvedModel,dispNodeDict,scale)
                else:
                    #BEAM
                    defModel1 = alpacaView.BeamDefExtrude(AlpacaSolvedModel, dispNodeDict,scale)
                    self.defModel1 = alpacaView.ColorBeamDefExtrude( defModel1, defEleVector1, bound, listColor, typeColor)
                    #SHELL
                    defModel2 = alpacaView.ShellDefExtrude(AlpacaSolvedModel,dispNodeDict,scale)
                    #BRICK
                    defModel3 = alpacaView.BrickDef(AlpacaSolvedModel,dispNodeDict,scale)
                    
                #SHELL COLOR
                self.defModel2 = alpacaView.ColorShellDef( defModel2, defEleVector2 , bound, listColor, typeColor, extrudeModel )
                #BRICK COLOR
                self.defModel3 = alpacaView.ColorBrickDef( defModel3, defEleVector3 , bound, listColor, typeColor)
                DefModel = th.list_to_tree(self.defModel1 + defModel2 + defModel3)
                bounds = ConstructDomain(bound[0], bound[1])
                return (DefModel, bounds)
            except:
                Hdf5.CloseFile(fileId)
                print("I have closed the file due to exception")
            # return outputs if you have them; here I try it for you:
        
        
    def DrawViewportWires(self,arg):
        for iMesh in self.defModel2 :
            colorWirframe = System.Drawing.Color.Black
            arg.Display.DrawMeshWires(iMesh, colorWirframe)
            
        for iMesh in self.defModel3 :
            colorWirframe = System.Drawing.Color.Black
            arg.Display.DrawMeshWires(iMesh, colorWirframe)
        if self.extrudeModel is None or self.extrudeModel is False:
            thickness =2
            for iBeam, iColor in zip(self.defModel1, self.beamColor) :
                for jBeam, jColor in zip(iBeam, iColor):
                    arg.Display.DrawCurve(jBeam, jColor, thickness)
        else:
            for iBeam in self.defModel1 :
                colorWirframe = System.Drawing.Color.Black
                arg.Display.DrawMeshWires(iBeam, colorWirframe)
# ---------- end dm ----------

mjoin_4 = MeshJoin(Meshes=dm.DefModel)

# ----
# Reaction Force
alpaca_model = Data(ra.AlpacaSolvedModel)  # disabled
rf = ReactionForcesAlpaca4d(AlpacaModel=alpaca_model)  # -> out, SupportPosition, ReactionForce, ReactionMoment; inputs History: Boolean, step: Int32; disabled
# ---------- rf: Python ----------
"""
Read Reaction Forces
    Args:
        AlpacaModel:
        History:
        step:
    Returns:
        SupportPosition:
        ReactionForce:
        ReactionMoment:
        ReactionForce_History:
        ReactionMoment_History:
"""

ghenv.Component.Name = "Reaction Forces (Alpaca4d)"
ghenv.Component.NickName = 'RF'
ghenv.Component.Message = 'Reactions (Alpaca4d)'


import sys
import os
import System
from System.Drawing import Color


import clr
import clrtype
import Rhino.Geometry as rg
import rhinoscriptsyntax as rs
import Grasshopper as gh
import copy
import ghpythonlib.treehelpers as th



## add alpaca install directory to system path

ghcompfolder = gh.Folders.DefaultAssemblyFolder
if ghcompfolder not in sys.path:
    sys.path.append(ghcompfolder)

try:
    from Alpaca4d import alpaca4d as alpaca
except:
    msg = "Cannot import Alpaca4d. Is the Alpaca4d folder available in " + ghcompfolder + "?"
    ghenv.Component.AddRuntimeMessage(gh.Kernel.GH_RuntimeMessageLevel.Error, msg)



FolderPath = rs.DocumentPath()
os.chdir(FolderPath)

my_module_name = "Alpaca_StepReader" # replace this with something unique that doesn't collide with a real module!
my_module = sys.modules.setdefault(my_module_name, type(sys)(my_module_name))

hdfFilePath = os.path.join(ghcompfolder, "Alpaca4d\HDF5CSharp.dll")
clr.AddReferenceToFileAndPath(hdfFilePath)


from HDF5CSharp import Hdf5

try:
    Steps = my_module.Steps
except AttributeError:
    type_2d = type(System.Array.CreateInstance(float, 1, 1))

    class Steps(object):
        __metaclass__ = clrtype.ClrClass
        _clrfields = {"STEP_{}".format(i): type_2d for i in range(1000)} # it will work for model with less than 1000 steps

    my_module.Steps = Steps



checkData = True

if not AlpacaModel:
    checkData = False
    msg = "Input parameter AlpacaModel failed to collect data"
    ghenv.Component.AddRuntimeMessage(gh.Kernel.GH_RuntimeMessageLevel.Warning, msg)



History = False if History is None else History


if checkData:
    step = (int(AlpacaModel.analysis.AnalysisSteps.numIncr) - 1) if step is None else step
    supportTagLocation = [item.nodeTag - 1 for item in AlpacaModel.supports] #
    
    if not History:
    
        try:
            fileId = Hdf5.OpenFile(AlpacaModel.recorderName, True)
            
            
            reactionForceResult = Hdf5.ReadObject[Steps](fileId, "/MODEL_STAGE[1]/RESULTS/ON_NODES/REACTION_FORCE/DATA")
            ReactionForce = []
            for i in supportTagLocation:
                x = getattr(reactionForceResult, 'STEP_{}'.format(step))[i,0]
                y = getattr(reactionForceResult, 'STEP_{}'.format(step))[i,1]
                z = getattr(reactionForceResult, 'STEP_{}'.format(step))[i,2]
                ReactionForce.append(rg.Vector3d(x,y,z))
            
            
            ReactionMomentResult = Hdf5.ReadObject[Steps](fileId, "/MODEL_STAGE[1]/RESULTS/ON_NODES/REACTION_MOMENT/DATA")
            ReactionMoment = []
            for i in supportTagLocation:
                x = getattr(ReactionMomentResult, 'STEP_{}'.format(step))[i,0]
                y = getattr(ReactionMomentResult, 'STEP_{}'.format(step))[i,1]
                z = getattr(ReactionMomentResult, 'STEP_{}'.format(step))[i,2]
                ReactionMoment.append(rg.Vector3d(x,y,z))
                
            Hdf5.CloseFile(fileId)
            
        except:
            if fileId >0:
                Hdf5.CloseFile(fileId)
                print("I have closed the file")
    
    
    if History:
        try:
            fileId = Hdf5.OpenFile(AlpacaModel.recorderName, True)
        
            maxNumberStep = int(AlpacaModel.analysis.AnalysisSteps.numIncr)
            
            reactionForceResult = Hdf5.ReadObject[Steps](fileId, "/MODEL_STAGE[1]/RESULTS/ON_NODES/REACTION_FORCE/DATA")
            ReactionForce = []
            for i in supportTagLocation:
                reactionForceTemp = []
                for n_step in range(maxNumberStep):
                    x = getattr(reactionForceResult, 'STEP_{}'.format(n_step))[i,0]
                    y = getattr(reactionForceResult, 'STEP_{}'.format(n_step))[i,1]
                    z = getattr(reactionForceResult, 'STEP_{}'.format(n_step))[i,2]
                    reactionForceTemp.append(rg.Vector3d(x,y,z))
            
                ReactionForce.append(reactionForceTemp)
    
    
            reactionMomentResult = Hdf5.ReadObject[Steps](fileId, "/MODEL_STAGE[1]/RESULTS/ON_NODES/REACTION_MOMENT/DATA")
            ReactionMoment = []
            for i in supportTagLocation:
                reactionMomentTemp = []
                for n_step in range(maxNumberStep):
                    x = getattr(reactionMomentResult, 'STEP_{}'.format(n_step))[i,0]
                    y = getattr(reactionMomentResult, 'STEP_{}'.format(n_step))[i,1]
                    z = getattr(reactionMomentResult, 'STEP_{}'.format(n_step))[i,2]
                    reactionMomentTemp.append(rg.Vector3d(x,y,z))
            
                ReactionMoment.append(reactionMomentTemp)
            Hdf5.CloseFile(fileId)
            
        except:
            Hdf5.CloseFile(fileId)
    
    
    
    
    SupportPosition = [item.Pos for item in AlpacaModel.supports]
    ReactionForce = th.list_to_tree(ReactionForce)
    ReactionMoment = th.list_to_tree(ReactionMoment)
# ---------- end rf ----------
vec_8 = Vector(expr("x/1000", rf.ReactionForce))  # disabled
ma_3 = MassAddition(Input=vec_8)  # -> Result, PartialResults; disabled
vec_9 = Vector(expr("Round(x,2)", ma_3.Result))  # disabled
panel_32 = Panel(vec_9)  # disabled
devec_4 = DeconstructVector(Vector=vec_8)  # -> XComponent, YComponent, ZComponent; disabled
bnd_9 = Bounds(Numbers=devec_4.XComponent)  # disabled
bnd_10 = Bounds(Numbers=devec_4.YComponent)  # disabled
bnd_11 = Bounds(Numbers=devec_4.ZComponent)  # disabled
panel_33 = Panel(bnd_11)  # disabled
panel_34 = Panel(bnd_9)  # disabled
panel_35 = Panel(bnd_10)  # disabled

# ----
# Reaction Moment
alpaca_model_2 = Data(ra.AlpacaSolvedModel)  # disabled
rf_2 = ReactionForcesAlpaca4d(AlpacaModel=alpaca_model_2)  # -> out, SupportPosition, ReactionForce, ReactionMoment; inputs History: Boolean, step: Int32; disabled; same code as rf
vec_10 = Vector(expr("x/1000", rf_2.ReactionMoment))  # disabled
ma_4 = MassAddition(Input=vec_10)  # -> Result, PartialResults; disabled
vec_11 = Vector(expr("Round(x,2)", ma_4.Result))  # disabled
panel_36 = Panel(vec_11)  # disabled
devec_5 = DeconstructVector(Vector=vec_10)  # -> XComponent, YComponent, ZComponent; disabled
bnd_12 = Bounds(Numbers=devec_5.XComponent)  # disabled
bnd_13 = Bounds(Numbers=devec_5.YComponent)  # disabled
bnd_14 = Bounds(Numbers=devec_5.ZComponent)  # disabled
panel_37 = Panel(bnd_14)  # disabled
panel_38 = Panel(bnd_12)  # disabled
panel_39 = Panel(bnd_13)  # disabled

alpaca_model_3 = Data(ra.AlpacaSolvedModel)
nd = NodalDisplacementsAlpaca4d(AlpacaModel=alpaca_model_3)  # -> out, displacement, rotation; inputs History: Boolean, step: Int32
# ---------- nd: Python ----------
"""
Read displacement results
-
    Args:
        AlpacaModel:
        History: True to visualise the displacement and rotation history of the points
        step:
    Returns:
        displacement:
        rotation:
        displacement_History:
        rotation_History:
"""

ghenv.Component.Name = "Nodal Displacements (Alpaca4d)"
ghenv.Component.NickName = 'ND'
ghenv.Component.Message = "Displacements (Alpaca4d)"

import sys
import os
import System
from System.Drawing import Color


import clr
import clrtype
import Rhino.Geometry as rg
import rhinoscriptsyntax as rs
import Grasshopper as gh
import copy
import ghpythonlib.treehelpers as th



## add alpaca install directory to system path

ghcompfolder = gh.Folders.DefaultAssemblyFolder
if ghcompfolder not in sys.path:
    sys.path.append(ghcompfolder)

try:
    from Alpaca4d import alpaca4d as alpaca
except:
    msg = "Cannot import Alpaca4d. Is the Alpaca4d folder available in " + ghcompfolder + "?"
    ghenv.Component.AddRuntimeMessage(gh.Kernel.GH_RuntimeMessageLevel.Error, msg)



FolderPath = rs.DocumentPath()
os.chdir(FolderPath)

my_module_name = "Alpaca_StepReader" # replace this with something unique that doesn't collide with a real module!
my_module = sys.modules.setdefault(my_module_name, type(sys)(my_module_name))

hdfFilePath = os.path.join(ghcompfolder, "Alpaca4d\HDF5CSharp.dll")
clr.AddReferenceToFileAndPath(hdfFilePath)


from HDF5CSharp import Hdf5

try:
    Steps = my_module.Steps
except AttributeError:
    type_2d = type(System.Array.CreateInstance(float, 1, 1))

    class Steps(object):
        __metaclass__ = clrtype.ClrClass
        _clrfields = {"STEP_{}".format(i): type_2d for i in range(1000)} # it will work for model with less than 1000 steps

    my_module.Steps = Steps



checkData = True

if not AlpacaModel:
    checkData = False
    msg = "Input parameter AlpacaModel failed to collect data"
    ghenv.Component.AddRuntimeMessage(gh.Kernel.GH_RuntimeMessageLevel.Warning, msg)



History = False if History is None else History


if checkData:
    step = (int(AlpacaModel.analysis.AnalysisSteps.numIncr) - 1) if step is None else step
    numberOfPoints = len(AlpacaModel.uniquePoints) #
    
    if not History:
        try:
            fileId = Hdf5.OpenFile(AlpacaModel.recorderName, True)
            
            
            displacementResult = Hdf5.ReadObject[Steps](fileId, "/MODEL_STAGE[1]/RESULTS/ON_NODES/DISPLACEMENT/DATA")
            displacement = []
            for i in range(numberOfPoints):
                x = getattr(displacementResult, 'STEP_{}'.format(step))[i,0]
                y = getattr(displacementResult, 'STEP_{}'.format(step))[i,1]
                z = getattr(displacementResult, 'STEP_{}'.format(step))[i,2]
                displacement.append(rg.Vector3d(x,y,z))
            
            
            rotationResult = Hdf5.ReadObject[Steps](fileId, "/MODEL_STAGE[1]/RESULTS/ON_NODES/ROTATION/DATA")
            rotation = []
            for i in range(numberOfPoints):
                x = getattr(rotationResult, 'STEP_{}'.format(step))[i,0]
                y = getattr(rotationResult, 'STEP_{}'.format(step))[i,1]
                z = getattr(rotationResult, 'STEP_{}'.format(step))[i,2]
                rotation.append(rg.Vector3d(x,y,z))
                
                
            Hdf5.CloseFile(fileId)
            print("I have closed the file")
        except:
            if fileId >0:
                Hdf5.CloseFile(fileId)
                print("I have closed the file because of exception")
    
    
    
    if History:
        try:
            fileId = Hdf5.OpenFile(AlpacaModel.recorderName, True)
            
            displacementResult = Hdf5.ReadObject[Steps](fileId, "/MODEL_STAGE[1]/RESULTS/ON_NODES/DISPLACEMENT/DATA")
            displacement = []
            
            for i in range(numberOfPoints):
                dispTemp = []
                maxNumberStep = int(AlpacaModel.analysis.AnalysisSteps.numIncr)
                for n_step in range(maxNumberStep):
                    x = getattr(displacementResult, 'STEP_{}'.format(n_step))[i,0]
                    y = getattr(displacementResult, 'STEP_{}'.format(n_step))[i,1]
                    z = getattr(displacementResult, 'STEP_{}'.format(n_step))[i,2]
                    dispTemp.append(rg.Vector3d(x,y,z))
                    
                
                displacement.append(dispTemp)
    
    
    
    
            rotationResult = Hdf5.ReadObject[Steps](fileId, "/MODEL_STAGE[1]/RESULTS/ON_NODES/ROTATION/DATA")
            
            rotation = []
            
            for i in range(numberOfPoints):
                rotationTemp = []
                for n_step in range(maxNumberStep):
                    x = getattr(rotationResult, 'STEP_{}'.format(n_step))[i,0]
                    y = getattr(rotationResult, 'STEP_{}'.format(n_step))[i,1]
                    z = getattr(rotationResult, 'STEP_{}'.format(n_step))[i,2]
                    rotationTemp.append(rg.Vector3d(x,y,z))
                
                rotation.append(rotationTemp)
                
            Hdf5.CloseFile(fileId)
        except:
            Hdf5.CloseFile(fileId)
    
    
    displacement = th.list_to_tree(displacement)
    rotation = th.list_to_tree(rotation)
# ---------- end nd ----------
vec_12 = Vector(nd.displacement)
vlen_2 = VectorLength(Vector=vec_12)
devec_6 = DeconstructVector(Vector=vec_12)  # -> XComponent, YComponent, ZComponent
bnd_15 = Bounds(Numbers=devec_6.YComponent)
bnd_16 = Bounds(Numbers=vlen_2)
panel_40 = Panel(bnd_15)
dedomain_2 = DeconstructDomain(Domain=bnd_16)  # -> Start, End
multiplication_2 = Multiplication(A=dedomain_2.End, B=1000)
num_7 = Number(expr("Round(x,2)", multiplication_2))
panel_41 = Panel(num_7)

# ----
# Vibration Mode
alpaca_model_4 = Data(am.AlpacaModel)  # disabled
num_8 = Number(number_vibration_modes)  # disabled
nv = RunNaturalVibrationAnalysisAlpaca4d(AlpacaModel=alpaca_model_4, numberModes=num_8)  # -> log, AlpacaSolvedModel, EigenValues, Period, NaturalFrequencies; inputs numberModes: Int32; disabled
# ---------- nv: Python ----------
"""
Run an Natural Vibration Analysis
-
    Args:
        AlpacaModel:
        numberModes:
    Returns:
        AlpacaSolvedModel:
        EigenValues:
        Period:
        NaturalFrequencies:
"""



import Rhino.RhinoDoc
import Grasshopper as gh
import copy
import rhinoscriptsyntax as rs
import os
import time
import sys
import math


ghenv.Component.Name = "Run Natural Vibration Analysis (Alpaca4d)"
ghenv.Component.NickName = 'NV'
ghenv.Component.Message = "Natural Vibration Analysis (Alpaca4d)"

ghcompfolder = gh.Folders.DefaultAssemblyFolder
if ghcompfolder not in sys.path:
    sys.path.append(ghcompfolder)

try:
    from Alpaca4d import alpaca4d as alpaca
except:
    msg = "Cannot import Alpaca4d. Is the Alpaca4d folder available in " + ghcompfolder + "?"
    ghenv.Component.AddRuntimeMessage(gh.Kernel.GH_RuntimeMessageLevel.Error, msg)


checkData = True



if not AlpacaModel:
    checkData = False
    msg = "Input parameter AlpacaModel failed to collect data"
    ghenv.Component.AddRuntimeMessage(gh.Kernel.GH_RuntimeMessageLevel.Warning, msg)


if not numberModes:
    checkData = False
    msg = "Input parameter numberModes failed to collect data"
    ghenv.Component.AddRuntimeMessage(gh.Kernel.GH_RuntimeMessageLevel.Warning, msg)


if checkData:
    FolderPath = rs.DocumentPath()
    os.chdir(FolderPath)
    
    outputFileName = 'openSeesModel'
    recorderFileName = 'recorder_modes.mpco'
    
    for dirpath, dirnames, filenames in os.walk(FolderPath):
        for filename in filenames:
            if filename == outputFileName:
                file = os.path.join(dirpath,outputFileName)
                os.remove(file)
            elif filename == recorderFileName:
                file = os.path.join(dirpath,recorderFileName)
                os.remove(file)
    
    
    # create a copy
    
    AnalysisModel = copy.copy(AlpacaModel)
    AnalysisModel.py = list(AnalysisModel.py)
    
    # generate Recorder and assign name
    AnalysisModel.recorderName = "recorder_modes" + ".mpco"
    
    AnalysisModel.py.append(alpaca.TCLRecorder.mpco(AnalysisModel.recorderName, False,False,False,False,True,True,False,False,False,False))
    
    
    eigen_tcl = "set lambdaN [eigen {}]".format(numberModes)
    AnalysisModel.py.append(eigen_tcl)
    
    
    AnalysisModel.py.append('puts "$lambdaN"\nrecord\nwipe')
    
    #textFile = AnalysisModel.py
    
    time_start = time.clock()
    
    AnalysisModel.writeFile(outputFileName)
    
    time_elapsed = (time.clock() - time_start)
    print("Writing Time {}".format(time_elapsed))
    
    
    
    time_start = time.clock()
    
    executable = os.path.join(ghcompfolder,'Alpaca4d\OpenSees-Solvers\opensees.bat')
    log, eigen = AnalysisModel.runEigen(executable)
    
    
    eigen = eigen[0].strip().split()
    
    EigenValues = [float(eigenValue) for eigenValue in eigen] 
    
    NaturalFrequencies = [math.sqrt(eigenValue) / (2 * math.pi) for eigenValue in EigenValues]
    Period = [1/naturalFrequency for naturalFrequency in NaturalFrequencies]
    
    
    AlpacaSolvedModel = copy.copy(AnalysisModel)
    AlpacaSolvedModel.isAnalysed = True
    AlpacaSolvedModel.isModal = True
# ---------- end nv ----------
panel_42 = Panel(nv.NaturalFrequencies)  # disabled

panel_43 = Panel(" ")
num_9 = Number(panel_30)
panel_44 = Panel(""":    

:   """)
num_10 = Number(num_7)
concat = Concatenate(FragmentA=panel_14, FragmentB=panel_44)
panel_45 = Panel(""" mm
 """)
entwine_3 = Entwine(Branch01=num_10, Branch03=num_9, FlattenInputs=True)  # -> simplify(Result)
merge_2 = Merge(Data1=panel_13, Data2=concat)
graft = GraftTree(Tree=panel_45, IncludeEmptyLists=True, IncludeNullItems=True)
concat_2 = Concatenate(FragmentA=simplify(graft(merge_2)), FragmentB=simplify(entwine_3), FragmentC=simplify(graft))  # -> flatten(Result)
panel_46 = Panel(concat_2)
number_slider = Slider(12, range=1..100)
lng_2 = ListLength(List=concat_2)
series = Series(Start=Slider(73, range=1..100), Step=expr("x*2", number_slider), Count=lng_2)
pt_4 = ConstructPoint(XCoordinate=Slider(42, range=1..100), YCoordinate=series, ZCoordinate=0)
texttoscreen = RenderTextToScreen(Text=concat_2, Location=pt_4, Size=number_slider, Color=RGB(0, 0, 0), Font="Inconsolata", m_scWithvp=False)

vss = ViewShellStressesAlpaca4d(AlpacaSolvedModel=ra.AlpacaSolvedModel, step=panel_16, stressType=list, listColor=clr)  # -> Shell; inputs step: Int32, stressType: Int32, listColor: list of Color; disabled
# ---------- vss: Python ----------
"""
Read Shell Stresses
-
    Args:
        AlpacaSolvedModel:
        step:
        stressType: 0-p11, 1-p22, 2-p12, 3-m11, 4-m22, 5-m12, 6-q1, 7-q2
        listColor:
    Returns:
        Shell
"""

ghenv.Component.Name = "View Shell Stresses (Alpaca4d)"
ghenv.Component.NickName = 'VSS'
ghenv.Component.Message = "View Shell Stresses (Alpaca4d)"

import sys
import os
import System
from System.Drawing import Color


import clr
import clrtype
import Rhino.Geometry as rg
import rhinoscriptsyntax as rs
import Grasshopper as gh
import copy
import ghpythonlib.treehelpers as th
from ghpythonlib.components import Bounds
import math as mt


## add alpaca install directory to system path

ghcompfolder = gh.Folders.DefaultAssemblyFolder
if ghcompfolder not in sys.path:
    sys.path.append(ghcompfolder)

try:
    from Alpaca4d import alpaca4d as alpaca
    from Alpaca4d import alpaca4dView as alpacaView
except:
    msg = "Cannot import Alpaca4d. Is the Alpaca4d folder available in " + ghcompfolder + "?"
    ghenv.Component.AddRuntimeMessage(gh.Kernel.GH_RuntimeMessageLevel.Error, msg)



FolderPath = rs.DocumentPath()
os.chdir(FolderPath)


# import costum modules to read the hdf5 file

my_module_name = "Alpaca_StepReader"
my_module = sys.modules.setdefault(my_module_name, type(sys)(my_module_name))

hdfFilePath = os.path.join(ghcompfolder, "Alpaca4d\HDF5CSharp.dll")
clr.AddReferenceToFileAndPath(hdfFilePath)

from HDF5CSharp import Hdf5

try:
    Steps = my_module.Steps
except AttributeError:
    type_2d = type(System.Array.CreateInstance(float, 1, 1))

    class Steps(object):
        __metaclass__ = clrtype.ClrClass
        _clrfields = {"STEP_{}".format(i): type_2d for i in range(1000)} # it will work for model with less than 1000 steps

    my_module.Steps = Steps


checkData = True

if not AlpacaSolvedModel:
    checkData = False
    msg = "Input parameter AlpacaModel failed to collect data"
    ghenv.Component.AddRuntimeMessage(gh.Kernel.GH_RuntimeMessageLevel.Warning, msg)

if stressType is None:
    stressType = 0

if not listColor: listColor = [ System.Drawing.Color.DarkBlue, 
                                System.Drawing.Color.RoyalBlue, 
                                System.Drawing.Color.CornflowerBlue,
                                System.Drawing.Color.LightSkyBlue, 
                                System.Drawing.Color.LightBlue,
                                System.Drawing.Color.CadetBlue,
                                System.Drawing.Color.White,
                                System.Drawing.Color.Yellow,
                                System.Drawing.Color.Orange,
                                System.Drawing.Color.Red,
                                System.Drawing.Color.DarkRed]

if checkData:
    
    try:
        step = (int(AlpacaSolvedModel.analysis.NumberOfSteps) - 1) if step is None else step
        fileId = Hdf5.OpenFile(AlpacaSolvedModel.recorderName, True)
        
        shellSortedByeleTag = sorted(AlpacaSolvedModel.shells, key=lambda x: x.eleTag)
        
        ShellDKGT = []
        ShellMITC4 = []
        ASDShellQ4 = []
        
        
        for item in shellSortedByeleTag:
            if item.elementType == "ShellDKGT":
                ShellDKGT.append(item)
            elif item.elementType == "ShellMITC4":
                ShellMITC4.append(item)
            elif item.elementType == "ASDShellQ4":
                ASDShellQ4.append(item)
        
        shellElements = [ShellDKGT, ShellMITC4, ASDShellQ4]
        
        #shellMITC4
        stressResultMITC4 = Hdf5.ReadObject[Steps](fileId, "/MODEL_STAGE[1]/RESULTS/ON_ELEMENTS/stresses/53-UnknownMovableObject[201:0:0]/DATA")
        #ShellNLDKGT
        stressResultNLDKGT = Hdf5.ReadObject[Steps](fileId, "/MODEL_STAGE[1]/RESULTS/ON_ELEMENTS/stresses/167-UnknownMovableObject[103:0:0]/DATA")
        #asdea shell
        stressResultASDShellQ4 = Hdf5.ReadObject[Steps](fileId, "/MODEL_STAGE[1]/RESULTS/ON_ELEMENTS/stresses/203-UnknownMovableObject[201:0:0]/DATA")
        
        stress = []
        
        for j,stressResult in enumerate([stressResultNLDKGT, stressResultMITC4, stressResultASDShellQ4]):
            for i in range(len(shellElements[j])):
                p11_0 = getattr(stressResult, 'STEP_{}'.format(step))[i,0]
                p11_1 = getattr(stressResult, 'STEP_{}'.format(step))[i,8]
                p11_2 = getattr(stressResult, 'STEP_{}'.format(step))[i,16]
                p11_3 = getattr(stressResult, 'STEP_{}'.format(step))[i,24]
                
                p11 = [p11_0,p11_1,p11_2,p11_3]
                
                
                p22_0 = getattr(stressResult, 'STEP_{}'.format(step))[i,1]
                p22_1 = getattr(stressResult, 'STEP_{}'.format(step))[i,9]
                p22_2 = getattr(stressResult, 'STEP_{}'.format(step))[i,17]
                p22_3 = getattr(stressResult, 'STEP_{}'.format(step))[i,25]
                
                p22 = [p22_0,p22_1,p22_2,p22_3]
                
                
                p12_0 = getattr(stressResult, 'STEP_{}'.format(step))[i,2]
                p12_1 = getattr(stressResult, 'STEP_{}'.format(step))[i,10]
                p12_2 = getattr(stressResult, 'STEP_{}'.format(step))[i,18]
                p12_3 = getattr(stressResult, 'STEP_{}'.format(step))[i,26]
                
                p12 = [p12_0,p12_1,p12_2,p12_3]
                
                
                m11_0 = getattr(stressResult, 'STEP_{}'.format(step))[i,3]
                m11_1 = getattr(stressResult, 'STEP_{}'.format(step))[i,11]
                m11_2 = getattr(stressResult, 'STEP_{}'.format(step))[i,19]
                m11_3 = getattr(stressResult, 'STEP_{}'.format(step))[i,27]
                
                m11 = [m11_0,m11_1,m11_2,m11_3]
                
                
                m22_0 = getattr(stressResult, 'STEP_{}'.format(step))[i,4]
                m22_1 = getattr(stressResult, 'STEP_{}'.format(step))[i,12]
                m22_2 = getattr(stressResult, 'STEP_{}'.format(step))[i,20]
                m22_3 = getattr(stressResult, 'STEP_{}'.format(step))[i,28]
                
                m22 = [m22_0,m22_1,m22_2,m22_3]
                
                
                m12_0 = getattr(stressResult, 'STEP_{}'.format(step))[i,5]
                m12_1 = getattr(stressResult, 'STEP_{}'.format(step))[i,13]
                m12_2 = getattr(stressResult, 'STEP_{}'.format(step))[i,21]
                m12_3 = getattr(stressResult, 'STEP_{}'.format(step))[i,29]
                
                m12 = [m12_0,m12_1,m12_2,m12_3]
                
                
                q1_0 = getattr(stressResult, 'STEP_{}'.format(step))[i,6]
                q1_1 = getattr(stressResult, 'STEP_{}'.format(step))[i,14]
                q1_2 = getattr(stressResult, 'STEP_{}'.format(step))[i,22]
                q1_3 = getattr(stressResult, 'STEP_{}'.format(step))[i,30]
                
                q1 = [q1_0,q1_1,q1_2,q1_3]
                
                
                q2_0 = getattr(stressResult, 'STEP_{}'.format(step))[i,7]
                q2_1 = getattr(stressResult, 'STEP_{}'.format(step))[i,15]
                q2_2 = getattr(stressResult, 'STEP_{}'.format(step))[i,23]
                q2_3 = getattr(stressResult, 'STEP_{}'.format(step))[i,31]
                
                q2 = [q2_0,q2_1,q2_2,q2_3]
                
                stress.append([ p11, p22, p12, m11, m22, m12, q1, q2 ]) 
                
        Hdf5.CloseFile(fileId)
        print("I have close the file")
    except:
        Hdf5.CloseFile(fileId)
        print("I have close the file")


    ListValor = [ row[stressType] for row in stress ]
    ListFlatten = []
    for i in ListValor:
        for j in i:
            ListFlatten.append(j)
            
    bounds = Bounds(ListFlatten)
    shellElement = ShellDKGT + ShellMITC4 + ASDShellQ4
    Shell = alpacaView.ColorShellStress( shellElement, ListValor, bounds, listColor)
# ---------- end vss ----------

# ----
# Analyses Task
panel_47 = Panel("{0}")  # disabled
split_2 = SplitTree(Data=simplify(split), Masks=flatten(panel_47))  # -> Positive, Negative; disabled
merge_3 = Merge(Data1=gglc, Data2=gglc_2)  # disabled
task_name = Panel("Liner Analyses")  # disabled
ggsa = GgGSAAnalysisStatic(Name=task_name, ID=0, GeometricFrontVector=Vector(0, 0, 1), MaxIterations=0)  # disabled
panel_48 = Panel(" + ")  # disabled

# ---- group: Gsa doesn't like 0 as load factor
equals = Equality(FirstNumber=split_2.Negative, SecondNumber=0)  # -> Equality, Inequality; disabled

# ----
cull_multiple = CullMultiple(L0=split_2.Negative, L1=split_2.Positive, L2=merge_3, P=equals.Inequality)  # -> L0, L1, L2; disabled
concat_3 = Concatenate(FragmentA=cull_multiple.L0, FragmentB=cull_multiple.L1, JoinSeparator="_")  # disabled
join = TextJoin(Text=concat_3, Join=panel_48)  # disabled
ggac_2 = GgGSAAnalysisCase(Name=join, ID=1, StructAnalysisTask=ggsa, StructLoadCase=cull_multiple.L2, LoadFactors=cull_multiple.L0)  # disabled

ggs = GgGSASolver(
    Enabled=toggle_3,
    NewModel=True,
    CloseModel=True,
    AnalysisTasks=flatten([ggsa, ggma_2]),
    Q=flatten(entwine),
    PreSave=False)  # disabled
bang = ExplodeTree(Data=ggs)  # -> Branch0, Branch1, Branch2, Branch3, Branch4, Branch5; disabled

gsa_model = Data(bang.Branch3)  # disabled
ggrdn = GgGSADecomposeResultSetNode(R=gsa_model)  # -> NodeIDs, Case, Result, Unit, V, Max, Min; disabled
vec_13 = Vector(expr("x/1000", ggrdn.V))  # disabled
ma_5 = MassAddition(Input=vec_13)  # -> Result, PartialResults; disabled
vec_14 = Vector(expr("Round(x,2)", ma_5.Result))  # disabled
panel_49 = Panel(vec_14)  # disabled
devec_7 = DeconstructVector(Vector=vec_13)  # -> XComponent, YComponent, ZComponent; disabled
bnd_17 = Bounds(Numbers=devec_7.XComponent)  # disabled
bnd_18 = Bounds(Numbers=devec_7.YComponent)  # disabled
bnd_19 = Bounds(Numbers=devec_7.ZComponent)  # disabled
panel_50 = Panel(bnd_19)  # disabled
panel_51 = Panel(bnd_18)  # disabled
panel_52 = Panel(bnd_17)  # disabled

gsa_model_2 = Data(bang.Branch4)  # disabled
ggrdn_2 = GgGSADecomposeResultSetNode(R=gsa_model_2)  # -> NodeIDs, Case, Result, Unit, V, Max, Min; disabled
vec_15 = Vector(expr("x/1000", ggrdn_2.V))  # disabled
ma_6 = MassAddition(Input=vec_15)  # -> Result, PartialResults; disabled
vec_16 = Vector(expr("Round(x,2)", ma_6.Result))  # disabled
panel_53 = Panel(vec_16)  # disabled
devec_8 = DeconstructVector(Vector=vec_15)  # -> XComponent, YComponent, ZComponent; disabled
bnd_20 = Bounds(Numbers=devec_8.XComponent)  # disabled
bnd_21 = Bounds(Numbers=devec_8.YComponent)  # disabled
bnd_22 = Bounds(Numbers=devec_8.ZComponent)  # disabled
panel_54 = Panel(bnd_22)  # disabled
panel_55 = Panel(bnd_21)  # disabled
panel_56 = Panel(bnd_20)  # disabled

gsa_model_3 = Data(bang.Branch0)  # disabled
ggrdn_3 = GgGSADecomposeResultSetNode(R=gsa_model_3)  # -> NodeIDs, Case, Result, Unit, V, Max, Min; disabled
vec_17 = Vector(ggrdn_3.V)  # disabled
vlen_3 = VectorLength(Vector=vec_17)  # disabled
devec_9 = DeconstructVector(Vector=vec_17)  # -> XComponent, YComponent, ZComponent; disabled
bnd_23 = Bounds(Numbers=devec_9.YComponent)  # disabled
bnd_24 = Bounds(Numbers=vlen_3)  # disabled
panel_57 = Panel(bnd_23)  # disabled
dedomain_3 = DeconstructDomain(Domain=bnd_24)  # -> Start, End; disabled
multiplication_3 = Multiplication(A=dedomain_3.End, B=1000)  # disabled
num_11 = Number(expr("Round(x,2)", multiplication_3))  # disabled
panel_58 = Panel(num_11)  # disabled

gsa_model_4 = Data(bang.Branch5)  # disabled
panel_59 = Panel(gsa_model_4)  # disabled

# ----
# Internal Forces
ggrd2dset = GgGSADecomposeResultSet2d(R=bang.Branch1)  # -> ElementIDs, Case, Result, Unit, Nodes, Values, Max, Min; disabled
ggrd2dset_2 = GgGSADecomposeResultSet2d(R=bang.Branch2)  # -> ElementIDs, Case, Result, Unit, Nodes, Values, Max, Min; disabled
panel_60 = Panel("4")  # disabled
panel_61 = Panel(ggrd2dset_2.Result)  # disabled
panel_62 = Panel("4")  # disabled
partition = PartitionList(List=ggrd2dset_2.Values, Size=panel_60)  # disabled
partition_2 = PartitionList(List=ggrd2dset.Values, Size=panel_62)  # disabled
path_mapper = PathMapper(partition, source="{a;b}(i)", target="{b;a}(i)")  # disabled
path_mapper_2 = PathMapper(partition_2, source="{a;b}(i)", target="{b;a}(i)")  # disabled
data_12 = Data(simplify(path_mapper))  # disabled
data_13 = Data(simplify(path_mapper_2))  # disabled
tstat = TreeStatistics(Tree=data_13)  # -> Paths, Length, Count; disabled
panel_63 = Panel("-1")  # disabled
item_7 = ListItem(List=tstat.Paths, Index=panel_63, Wrap=True)  # disabled
panel_64 = Panel("0")  # disabled
panel_65 = Panel("0")  # disabled
explode_2 = ExplodeAtIndex(Data=data_12, Index=panel_64, VaryingIndices=True)  # -> _0, _1, _2, _3, _4; disabled
explode_3 = ExplodeAtIndex(Data=data_13, Index=panel_65, VaryingIndices=True)  # -> _0, _1, _2, _3, _4; disabled
branch = TreeBranch(Tree=data_13, Path=item_7, MaintainPaths=True)  # disabled
merge_4 = Merge(Data1=explode_3._4, Data2=branch)  # disabled
ss = ShellStressesAlpaca4d(AlpacaModel=ra.AlpacaSolvedModel)  # -> out, p11, p22, p12, m11, m22, m12, q1, q2; inputs History: Boolean, step: Int32; disabled
# ---------- ss: Python ----------
"""
Read Shell Stresses
-
    Args:
        AlpacaModel:
        step:
    Returns:
        p11:
        p22:
        p12:
        m11:
        m22:
        m12:
        q1:
        q2:
"""

ghenv.Component.Name = "Shell Stresses (Alpaca4d)"
ghenv.Component.NickName = 'SS'
ghenv.Component.Message = "Shell Stresses (Alpaca4d)"

import sys
import os
import System
from System.Drawing import Color


import clr
import clrtype
import Rhino.Geometry as rg
import rhinoscriptsyntax as rs
import Grasshopper as gh
import copy
import ghpythonlib.treehelpers as th


## add alpaca install directory to system path

ghcompfolder = gh.Folders.DefaultAssemblyFolder
if ghcompfolder not in sys.path:
    sys.path.append(ghcompfolder)

try:
    from Alpaca4d import alpaca4d as alpaca
except:
    msg = "Cannot import Alpaca4d. Is the Alpaca4d folder available in " + ghcompfolder + "?"
    ghenv.Component.AddRuntimeMessage(gh.Kernel.GH_RuntimeMessageLevel.Error, msg)



FolderPath = rs.DocumentPath()
os.chdir(FolderPath)


# import costum modules to read the hdf5 file

my_module_name = "Alpaca_StepReader"
my_module = sys.modules.setdefault(my_module_name, type(sys)(my_module_name))

hdfFilePath = os.path.join(ghcompfolder, "Alpaca4d\HDF5CSharp.dll")
clr.AddReferenceToFileAndPath(hdfFilePath)

from HDF5CSharp import Hdf5

try:
    Steps = my_module.Steps
except AttributeError:
    type_2d = type(System.Array.CreateInstance(float, 1, 1))

    class Steps(object):
        __metaclass__ = clrtype.ClrClass
        _clrfields = {"STEP_{}".format(i): type_2d for i in range(1000)} # it will work for model with less than 1000 steps

    my_module.Steps = Steps


checkData = True

if not AlpacaModel:
    checkData = False
    msg = "Input parameter AlpacaModel failed to collect data"
    ghenv.Component.AddRuntimeMessage(gh.Kernel.GH_RuntimeMessageLevel.Warning, msg)

History = False if History is None else History



if checkData:
    
    step = (int(AlpacaModel.analysis.AnalysisSteps.numIncr) - 1) if step is None else step
# read result
    
    p11 = []
    p22 = []
    p12 = []
    
    m11 = []
    m22 = []
    m12 = []
    
    q1 = []
    q2 = []
    
    
    
    ## to fix the issue about index of different type of object
    
    if History == False:
        try:
            fileId = Hdf5.OpenFile(AlpacaModel.recorderName, True)
            
            
            
            shellSortedByeleTag = sorted(AlpacaModel.shells, key=lambda x: x.eleTag)
            
            ShellDKGT = []
            ShellMITC4 = []
            ASDShellQ4 = []
            
            
            for item in shellSortedByeleTag:
                if item.elementType == "ShellDKGT":
                    ShellDKGT.append(item)
                elif item.elementType == "ShellMITC4":
                    ShellMITC4.append(item)
                elif item.elementType == "ASDShellQ4":
                    ASDShellQ4.append(item)
            
            shellElements = [ShellDKGT, ShellMITC4, ASDShellQ4]
            
            #shellMITC4
            stressResultMITC4 = Hdf5.ReadObject[Steps](fileId, "/MODEL_STAGE[1]/RESULTS/ON_ELEMENTS/stresses/53-UnknownMovableObject[201:0:0]/DATA")
            #ShellNLDKGT
            stressResultNLDKGT = Hdf5.ReadObject[Steps](fileId, "/MODEL_STAGE[1]/RESULTS/ON_ELEMENTS/stresses/167-UnknownMovableObject[103:0:0]/DATA")
            #asdea shell
            stressResultASDShellQ4 = Hdf5.ReadObject[Steps](fileId, "/MODEL_STAGE[1]/RESULTS/ON_ELEMENTS/stresses/203-UnknownMovableObject[201:0:0]/DATA")
            
            for j,stressResult in enumerate([stressResultNLDKGT, stressResultMITC4, stressResultASDShellQ4]):
                for i in range(len(shellElements[j])):
                    p11_0 = getattr(stressResult, 'STEP_{}'.format(step))[i,0]
                    p11_1 = getattr(stressResult, 'STEP_{}'.format(step))[i,8]
                    p11_2 = getattr(stressResult, 'STEP_{}'.format(step))[i,16]
                    p11_3 = getattr(stressResult, 'STEP_{}'.format(step))[i,24]
                    
                    p11.append([p11_0,p11_1,p11_2,p11_3])
                    
                    
                    
                    p22_0 = getattr(stressResult, 'STEP_{}'.format(step))[i,1]
                    p22_1 = getattr(stressResult, 'STEP_{}'.format(step))[i,9]
                    p22_2 = getattr(stressResult, 'STEP_{}'.format(step))[i,17]
                    p22_3 = getattr(stressResult, 'STEP_{}'.format(step))[i,25]
                    
                    p22.append([p22_0,p22_1,p22_2,p22_3])
                    
                    
                    p12_0 = getattr(stressResult, 'STEP_{}'.format(step))[i,2]
                    p12_1 = getattr(stressResult, 'STEP_{}'.format(step))[i,10]
                    p12_2 = getattr(stressResult, 'STEP_{}'.format(step))[i,18]
                    p12_3 = getattr(stressResult, 'STEP_{}'.format(step))[i,26]
                    
                    p12.append([p12_0,p12_1,p12_2,p12_3])
                    
                    
                    m11_0 = getattr(stressResult, 'STEP_{}'.format(step))[i,3]
                    m11_1 = getattr(stressResult, 'STEP_{}'.format(step))[i,11]
                    m11_2 = getattr(stressResult, 'STEP_{}'.format(step))[i,19]
                    m11_3 = getattr(stressResult, 'STEP_{}'.format(step))[i,27]
                    
                    m11.append([m11_0,m11_1,m11_2,m11_3])
                    
                    
                    m22_0 = getattr(stressResult, 'STEP_{}'.format(step))[i,4]
                    m22_1 = getattr(stressResult, 'STEP_{}'.format(step))[i,12]
                    m22_2 = getattr(stressResult, 'STEP_{}'.format(step))[i,20]
                    m22_3 = getattr(stressResult, 'STEP_{}'.format(step))[i,28]
                    
                    m22.append([m22_0,m22_1,m22_2,m22_3])
                    
                    
                    m12_0 = getattr(stressResult, 'STEP_{}'.format(step))[i,5]
                    m12_1 = getattr(stressResult, 'STEP_{}'.format(step))[i,13]
                    m12_2 = getattr(stressResult, 'STEP_{}'.format(step))[i,21]
                    m12_3 = getattr(stressResult, 'STEP_{}'.format(step))[i,29]
                    
                    m12.append([m12_0,m12_1,m12_2,m12_3])
                    
                    
                    q1_0 = getattr(stressResult, 'STEP_{}'.format(step))[i,6]
                    q1_1 = getattr(stressResult, 'STEP_{}'.format(step))[i,14]
                    q1_2 = getattr(stressResult, 'STEP_{}'.format(step))[i,22]
                    q1_3 = getattr(stressResult, 'STEP_{}'.format(step))[i,30]
                    
                    q1.append([q1_0,q1_1,q1_2,q1_3])
                    
                    
                    q2_0 = getattr(stressResult, 'STEP_{}'.format(step))[i,7]
                    q2_1 = getattr(stressResult, 'STEP_{}'.format(step))[i,15]
                    q2_2 = getattr(stressResult, 'STEP_{}'.format(step))[i,23]
                    q2_3 = getattr(stressResult, 'STEP_{}'.format(step))[i,31]
                    
                    q2.append([q2_0,q2_1,q2_2,q2_3])
                    
                    
                    
            Hdf5.CloseFile(fileId)
            print("I have close the file")
            
        except:
            Hdf5.CloseFile(fileId)
            print("I have close the file")
    
    
    elif History == True:
        try:
            fileId = Hdf5.OpenFile(AlpacaModel.recorderName, True)
        
            maxNumberStep = int(AlpacaModel.analysis.AnalysisSteps.numIncr)
            shellSortedByeleTag = sorted(AlpacaModel.shells, key=lambda x: x.eleTag)
            
            ShellDKGT = []
            ShellMITC4 = []
            ASDShellQ4 = []
            
            
            for item in shellSortedByeleTag:
                if item.elementType == "ShellDKGT":
                    ShellDKGT.append(item)
                elif item.elementType == "ShellMITC4":
                    ShellMITC4.append(item)
                elif item.elementType == "ASDShellQ4":
                    ASDShellQ4.append(item)
            
            shellElements = [ShellDKGT, ShellMITC4, ASDShellQ4]
            
            #shellMITC4
            stressResultMITC4 = Hdf5.ReadObject[Steps](fileId, "/MODEL_STAGE[1]/RESULTS/ON_ELEMENTS/stresses/53-UnknownMovableObject[201:0:0]/DATA")
            #ShellNLDKGT
            stressResultNLDKGT = Hdf5.ReadObject[Steps](fileId, "/MODEL_STAGE[1]/RESULTS/ON_ELEMENTS/stresses/167-UnknownMovableObject[103:0:0]/DATA")
            #asdea shell
            stressResultASDShellQ4 = Hdf5.ReadObject[Steps](fileId, "/MODEL_STAGE[1]/RESULTS/ON_ELEMENTS/stresses/203-UnknownMovableObject[201:0:0]/DATA")
            
            
            
            for j,stressResult in enumerate([stressResultNLDKGT, stressResultMITC4, stressResultASDShellQ4]):
                for i in range(len(shellElements[j])):
                    p11Temp = []
                    p22Temp = []
                    p12Temp = []
                    
                    m11Temp = []
                    m22Temp = []
                    m12Temp = []
                    
                    q1Temp = []
                    q2Temp = []
                    
                    
                    for n_step in range(maxNumberStep):
                        p11_0 = getattr(stressResult, 'STEP_{}'.format(n_step))[i,0]
                        p11_1 = getattr(stressResult, 'STEP_{}'.format(n_step))[i,8]
                        p11_2 = getattr(stressResult, 'STEP_{}'.format(n_step))[i,16]
                        p11_3 = getattr(stressResult, 'STEP_{}'.format(n_step))[i,24]
                        
                        p11Temp.append([p11_0,p11_1,p11_2,p11_3])
                        
                        
                        
                        p22_0 = getattr(stressResult, 'STEP_{}'.format(n_step))[i,1]
                        p22_1 = getattr(stressResult, 'STEP_{}'.format(n_step))[i,9]
                        p22_2 = getattr(stressResult, 'STEP_{}'.format(n_step))[i,17]
                        p22_3 = getattr(stressResult, 'STEP_{}'.format(n_step))[i,25]
                        
                        p22Temp.append([p22_0,p22_1,p22_2,p22_3])
                        
                        
                        p12_0 = getattr(stressResult, 'STEP_{}'.format(n_step))[i,2]
                        p12_1 = getattr(stressResult, 'STEP_{}'.format(n_step))[i,10]
                        p12_2 = getattr(stressResult, 'STEP_{}'.format(n_step))[i,18]
                        p12_3 = getattr(stressResult, 'STEP_{}'.format(n_step))[i,26]
                        
                        p12Temp.append([p12_0,p12_1,p12_2,p12_3])
                        
                        
                        m11_0 = getattr(stressResult, 'STEP_{}'.format(n_step))[i,3]
                        m11_1 = getattr(stressResult, 'STEP_{}'.format(n_step))[i,11]
                        m11_2 = getattr(stressResult, 'STEP_{}'.format(n_step))[i,19]
                        m11_3 = getattr(stressResult, 'STEP_{}'.format(n_step))[i,27]
                        
                        m11Temp.append([m11_0,m11_1,m11_2,m11_3])
                        
                        
                        m22_0 = getattr(stressResult, 'STEP_{}'.format(n_step))[i,4]
                        m22_1 = getattr(stressResult, 'STEP_{}'.format(n_step))[i,12]
                        m22_2 = getattr(stressResult, 'STEP_{}'.format(n_step))[i,20]
                        m22_3 = getattr(stressResult, 'STEP_{}'.format(n_step))[i,28]
                        
                        m22Temp.append([m22_0,m22_1,m22_2,m22_3])
                        
                        
                        m12_0 = getattr(stressResult, 'STEP_{}'.format(n_step))[i,5]
                        m12_1 = getattr(stressResult, 'STEP_{}'.format(n_step))[i,13]
                        m12_2 = getattr(stressResult, 'STEP_{}'.format(n_step))[i,21]
                        m12_3 = getattr(stressResult, 'STEP_{}'.format(n_step))[i,29]
                        
                        m12Temp.append([m12_0,m12_1,m12_2,m12_3])
                        
                        
                        q1_0 = getattr(stressResult, 'STEP_{}'.format(n_step))[i,6]
                        q1_1 = getattr(stressResult, 'STEP_{}'.format(n_step))[i,14]
                        q1_2 = getattr(stressResult, 'STEP_{}'.format(n_step))[i,22]
                        q1_3 = getattr(stressResult, 'STEP_{}'.format(n_step))[i,30]
                        
                        q1Temp.append([q1_0,q1_1,q1_2,q1_3])
                        
                        
                        q2_0 = getattr(stressResult, 'STEP_{}'.format(n_step))[i,7]
                        q2_1 = getattr(stressResult, 'STEP_{}'.format(n_step))[i,15]
                        q2_2 = getattr(stressResult, 'STEP_{}'.format(n_step))[i,23]
                        q2_3 = getattr(stressResult, 'STEP_{}'.format(n_step))[i,31]
                        
                        q2Temp.append([q2_0,q2_1,q2_2,q2_3])
                    
                    p11.append(p11Temp)
                    p22.append(p22Temp)
                    p12.append(p12Temp)
                    
                    m11.append(m11Temp)
                    m22.append(m22Temp)
                    m12.append(m12Temp)
                    
                    q1.append(q1Temp)
                    q2.append(q2Temp)
            Hdf5.CloseFile(fileId)
            print("I have close the file")
        except:
            Hdf5.CloseFile(fileId)
            print("I have close the file")
    
    
    shellElementsFlat = []
    for sublist in shellElements:
        for item in sublist:
            shellElementsFlat.append(item.eleTag)
    
    
    
    
    
    p11 = [x for _,x in sorted(zip(shellElementsFlat, p11))]
    p22 = [x for _,x in sorted(zip(shellElementsFlat, p22))]
    p12 = [x for _,x in sorted(zip(shellElementsFlat, p12))]
    
    
    m11 = [x for _,x in sorted(zip(shellElementsFlat, m11))]
    m22 = [x for _,x in sorted(zip(shellElementsFlat, m22))]
    m12 = [x for _,x in sorted(zip(shellElementsFlat, m12))]
    
    
    q1 = [x for _,x in sorted(zip(shellElementsFlat, q1))]
    q2 = [x for _,x in sorted(zip(shellElementsFlat, q2))]
    
    
    
    p11 = th.list_to_tree(p11)
    p22 = th.list_to_tree(p22)
    p12 = th.list_to_tree(p12)
    
    m11 = th.list_to_tree(m11)
    m22 = th.list_to_tree(m22)
    m12 = th.list_to_tree(m12)
    
    q1 = th.list_to_tree(q1)
    q2 = th.list_to_tree(q2)
# ---------- end ss ----------
entwine_4 = Entwine(
    Branch0X=explode_3._0,
    Branch1X=explode_3._1,
    Branch2X=explode_3._2,
    Branch3X=explode_2._0,
    Branch4X=explode_2._1,
    Branch5X=explode_2._2,
    Branch6X=explode_3._3,
    Branch7X=merge_4,
    FlattenInputs=False)  # -> simplify(Result); disabled
entwine_5 = Entwine(
    Branch0X=ss.p11,
    Branch1X=ss.p22,
    Branch2X=ss.p12,
    Branch3X=ss.m11,
    Branch4X=ss.m22,
    Branch5X=ss.m12,
    Branch6X=ss.q1,
    Branch7X=ss.q2,
    FlattenInputs=False)  # disabled
panel_66 = Panel(";?;?}")  # disabled
panel_67 = Panel(";?;?}")  # disabled
panel_68 = Panel("{")  # disabled
panel_69 = Panel("{")  # disabled
concat_4 = Concatenate(FragmentC=panel_68, FragmentA=list, FragmentB=panel_66)  # disabled
concat_5 = Concatenate(FragmentC=panel_69, FragmentA=list, FragmentB=panel_67)  # disabled
split_3 = SplitTree(Data=entwine_4, Masks=flatten(concat_4))  # -> simplify(Positive), Negative; disabled
split_4 = SplitTree(Data=entwine_5, Masks=flatten(concat_5))  # -> simplify(Positive), Negative; disabled
bnd_25 = Bounds(Numbers=split_3.Positive)  # disabled
bnd_26 = Bounds(Numbers=split_4.Positive)  # disabled
panel_70 = Panel(bnd_26)  # disabled
panel_71 = Panel(bnd_25)  # disabled
panel_72 = Panel("""2D Force, Nx
2D Force, Ny
2D Force, Nxy
2D Moment, Mx
2D Moment, My
2D Moment, Mxy
2D Through-Thk Shear, Qx
2D Through-Thk Shear, Qy""")  # disabled
merge_5 = Merge(Data1=panel_71, Data2=panel_70)  # -> simplify(Result); disabled
graft_2 = GraftTree(Tree=panel_72, IncludeEmptyLists=True, IncludeNullItems=True)  # disabled
panel_73 = Panel("0")  # disabled
ins = InsertItems(List=merge_5, Item=graft_2, Indices=panel_73, Wrap=True)  # disabled
panel_74 = Panel(ins)  # disabled

# ----
# Gsa Stress View
num_12 = Number(split_3.Positive)  # disabled
abs = Absolute(Value=flatten(num_12))  # disabled
sort_2 = SortList(Keys=abs)  # -> reverse(Keys), ValuesA; disabled
item_8 = ListItem(List=sort_2.Keys, Index=0, Wrap=True)  # disabled
multiplication_4 = Multiplication(A=item_8, B=1.5)  # disabled
domcen = CenteredDomain(DomainSize=flatten(multiplication_4))  # disabled
python_3 = GhPythonScript(x=ggmd.AreaElements)  # -> out, nodes, nodeIndex; disabled
# ---------- python_3: Python ----------
nodes = x.Nodes



nodeIndex = []
for node in nodes:
    nodeIndex.append(node.ID - 1)
# ---------- end python_3 ----------
remap = RemapNumbers(Value=num_12, Source=domcen, Target=Domain(0, 1))  # -> Mapped, Clipped; disabled
python_4 = GhPythonScript(x=python_3.nodes)  # -> out, a; disabled
# ---------- python_4: Python ----------
a = x.Point
# ---------- end python_4 ----------
twnthrucols = TweenThroughColors(
    Colors=clr,
    Factor=remap.Mapped,
    Normalized=True,
    Equalized=False,
    Weighted=False,
    Loopback=False,
    Degree=3,
    InterpolationType=0,
    Alpha=True)  # -> simplify(Tween); disabled
pt_5 = Point(python_4.a)  # disabled
python_5 = GhPythonScript(x=simplify(pt_5))  # -> out, a; inputs x: list; disabled
# ---------- python_5: Python ----------
import ghpythonlib.components as ghcomp

if len(x) == 4:
    a = ghcomp.MeshQuad(0,1,2,3)
elif len(x) == 3:
    a = ghcomp.MeshTriangle(0,1,2)
# ---------- end python_5 ----------
conmesh = ConstructMesh(Vertices=simplify(python_4.a), Faces=simplify(python_5.a), Colours=twnthrucols)  # disabled
mjoin_5 = MeshJoin(Meshes=flatten(conmesh))  # disabled

# ----
# Alpaca Stress View
num_13 = Number(split_4.Positive)  # disabled
abs_2 = Absolute(Value=flatten(num_13))  # disabled
sort_3 = SortList(Keys=abs_2)  # -> reverse(Keys), ValuesA; disabled
ds = DisassembleModelAlpaca4d(AlpacaModel=ra.AlpacaSolvedModel)  # -> out, Points, threeNdfPoints, sixNdfPoints, Beam, Shell, Brick, Support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; disabled
# ---------- ds: Python ----------
"""
Disassemble a Model
-
    Args:
        AlpacaModel:
    Returns:
        Points:
        threeNdfPoints:
        sixNdfPoints:
        
        Beam:
        Shell:
        Brick:
        Support:
        Constraint:
        TimeSeries:
        Load:
        Material:
"""

ghenv.Component.Name = "Disassemble Model (Alpaca4d)"
ghenv.Component.NickName = 'DS'
ghenv.Component.Message = "Disassemble Model (Alpaca4d)"


import sys
import Rhino.Geometry as rg
import Grasshopper as gh


## add alpaca install directory to system path

ghcompfolder = gh.Folders.DefaultAssemblyFolder
if ghcompfolder not in sys.path:
    sys.path.append(ghcompfolder)

try:
    from Alpaca4d import alpaca4d as alpaca
except:
    msg = "Cannot import Alpaca4d. Is the Alpaca4d folder available in " + ghcompfolder + "?"
    ghenv.Component.AddRuntimeMessage(gh.Kernel.GH_RuntimeMessageLevel.Error, msg)

checkData = True


if not AlpacaModel:
    checkData = False
    msg = "Input parameter AlpacaModel failed to collect data"
    ghenv.Component.AddRuntimeMessage(gh.Kernel.GH_RuntimeMessageLevel.Warning, msg)

if checkData:
    Points = AlpacaModel.uniquePoints
    threeNdfPoints = AlpacaModel.uniquePointsThreeNDF
    sixNdfPoints = AlpacaModel.uniquePointsSixNDF
    
    Beam = AlpacaModel.beams
    Shell  = AlpacaModel.shells
    Brick = AlpacaModel.bricks
    Support = AlpacaModel.supports
    Constraint = AlpacaModel.constraints
    TimeSeries = AlpacaModel.timeSeries
    Load = AlpacaModel.loads
    Material = AlpacaModel.materials
# ---------- end ds ----------
item_9 = ListItem(List=sort_3.Keys, Index=0, Wrap=True)  # disabled
multiplication_5 = Multiplication(A=item_9, B=1.5)  # disabled
domcen_2 = CenteredDomain(DomainSize=flatten(multiplication_5))  # disabled
python_6 = GhPythonScript(x=ds.Shell)  # -> out, a; disabled
# ---------- python_6: Python ----------
a = x.Mesh
# ---------- end python_6 ----------
remap_2 = RemapNumbers(Value=num_13, Source=domcen_2, Target=Domain(0, 1))  # -> Mapped, Clipped; disabled
demesh_3 = DeconstructMesh(Mesh=python_6.a)  # -> Vertices, Faces, Colours, Normals; disabled
pt_6 = Point(demesh_3.Vertices)  # disabled
twnthrucols_2 = TweenThroughColors(
    Colors=clr,
    Factor=remap_2.Mapped,
    Normalized=True,
    Equalized=False,
    Weighted=False,
    Loopback=False,
    Degree=3,
    InterpolationType=0,
    Alpha=True)  # disabled
python_7 = GhPythonScript(x=simplify(pt_6))  # -> out, a; inputs x: list; disabled; same code as python_5
conmesh_2 = ConstructMesh(Vertices=simplify(demesh_3.Vertices), Faces=simplify(python_7.a), Colours=simplify(twnthrucols_2))  # disabled
mjoin_6 = MeshJoin(Meshes=flatten(conmesh_2))  # disabled

# ----
# Gsa Deformed View
python_8 = GhPythonScript(x=ggmd.AreaElements)  # -> out, nodes, nodeIndex; disabled; same code as python_3
ggrdn_4 = GgGSADecomposeResultSetNode(R=bang.Branch0)  # -> NodeIDs, Case, Result, Unit, V, Max, Min; disabled
multiplication_6 = Multiplication(A=ggrdn_4.V, B=deformed_factor)  # disabled
vlen_4 = VectorLength(Vector=ggrdn_4.V)  # disabled
bnd_27 = Bounds(Numbers=vlen_4)  # disabled
item_10 = ListItem(List=vlen_4, Index=python_8.nodeIndex, Wrap=True)  # disabled
remap_3 = RemapNumbers(Value=item_10, Source=bnd_27, Target=Domain(0, 1))  # -> Mapped, Clipped; disabled
python_9 = GhPythonScript(x=python_8.nodes)  # -> out, a; disabled; same code as python_4
twnthrucols_3 = TweenThroughColors(
    Colors=clr,
    Factor=remap_3.Mapped,
    Normalized=True,
    Equalized=False,
    Weighted=False,
    Loopback=False,
    Degree=3,
    InterpolationType=0,
    Alpha=True)  # disabled
pt_7 = Point(python_9.a)  # disabled
item_11 = ListItem(List=multiplication_6, Index=python_8.nodeIndex, Wrap=True)  # disabled
move = Move(Geometry=pt_7, Motion=item_11)  # -> Geometry, Transform; disabled
python_10 = GhPythonScript(x=simplify(move.Geometry))  # -> out, a; inputs x: list; disabled; same code as python_5
conmesh_3 = ConstructMesh(Vertices=move.Geometry, Faces=python_10.a, Colours=twnthrucols_3)  # disabled
mjoin_7 = MeshJoin(Meshes=flatten(conmesh_3))  # disabled

mesh_4 = Mesh(mjoin_4)
mesh_5 = Mesh(shellview.MeshesOfRenderedShells)
mesh_6 = Mesh(mjoin_7)
number_slider_2 = Slider(6, range=0..6)
entwine_6 = Entwine(Branch00=mesh_4, Branch01=mesh_5, Branch02=mesh_6, FlattenInputs=True)  # -> flatten(Result)
series_2 = Series(Start=0, Step="10", Count="3")
X_2 = UnitX(Factor=series_2)
move_2 = Move(Geometry=entwine_2, Motion=X_2)  # -> Geometry, Transform
move_3 = Move(Geometry=entwine_6, Motion=X_2)  # -> Geometry, Transform
medges = MeshEdges(Mesh=move_2.Geometry)  # -> NakedEdges, InteriorEdges, NonManifoldEdges
mesh_7 = Mesh(move_3.Geometry)
bbox = BoundingBox(Content=mesh_7, Plane=PlaneXY(0, 0, 0))  # -> Box, Box_2
dash = DashPattern(Curve=[medges.NakedEdges, medges.InteriorEdges, medges.NonManifoldEdges], Pattern="0.05")  # -> Dashes, Gaps
debrep = DeconstructBrep(Brep=bbox.Box)  # -> Faces, Edges, Vertices
area = Area(Geometry=debrep.Faces)  # -> Area, Centroid
previewlw = CustomPreviewLineweights(Geometry=dash.Dashes, Shader=ColourSwatch(SwatchColor=RGB(33, 33, 33)), Thickness="1", Absolute=False)
pdecon_2 = Deconstruct(Point=area.Centroid)  # -> XComponent, YComponent, ZComponent
sort_4 = SortList(Keys=pdecon_2.ZComponent, ValuesA=area.Centroid)  # -> Keys, ValuesA
neg_2 = Negative(Value=Slider(0.65, range=0..5))
item_12 = ListItem(List=sort_4.ValuesA, Index=0, Wrap=True)
Z_2 = UnitZ(Factor=neg_2)
move_4 = Move(Geometry=item_12, Motion=Z_2)  # -> flatten(Geometry), Transform
screentext = ScreenOrientedText(
    Text=panel_14,
    Font="Inconsolata",
    Justification=5,
    Location=move_4.Geometry,
    SizeFactor=Slider(12, range=1..12),
    Depth=0,
    Absolute=False)

mesh_8 = Mesh(mjoin_7)  # disabled
panel_75 = Panel(remap_2.Mapped)  # disabled
mesh_9 = Mesh(mjoin_5)  # disabled
mesh_10 = Mesh(mjoin_6)  # disabled
move_5 = Move(Geometry=mesh_9, Motion=X)  # -> Geometry, Transform; disabled
