# Grasshopper definition AlpacaVsKaramba.gh (Grasshopper 1.0.7)
# plug-ins: Karamba, MeshEdit Components, Kangaroo Components, ggRhinoSAP, LunchBox, Weaverbird, Kangaroo2 Components, TetgenGH

brep = Brep(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)
mesh_brep = MeshBrep(
    Brep=brep,
    Settings={GridMaxCount=0, GridMinCount=16, JaggedSeams=False, MaxEdgeLength=0, MinEdgeLength=0.0001, MinTolerance=0, Refine=True, RefineAngle=0, RelativeTolerance=0, SimplePlanes=True, Tolerance=0})
tetrahedralize = Tetrahedralize(Mesh=mesh_brep, Flags=Slider(0, range=0..10), MinRatio=Slider(1.3, range=0..10))  # -> Mesh, Indices, Points
deconstruct_mesh = DeconstructMesh(Mesh=tetrahedralize.Mesh)  # -> Vertices, Faces, Colours, Normals
removeduplicatepts = RemoveDuplicatePts(Points=flatten(deconstruct_mesh.Vertices), Tolerance=0.01)
deconstruct = Deconstruct(Point=removeduplicatepts)  # -> XComponent, YComponent, ZComponent
deconstruct_2 = Deconstruct(Point=removeduplicatepts)  # -> XComponent, YComponent, ZComponent
smaller_than = SmallerThan(FirstNumber=deconstruct_2.XComponent, SecondNumber="0.1")  # -> SmallerThan, OrEqualTo
larger_than = LargerThan(FirstNumber=deconstruct.XComponent, SecondNumber="25")  # -> LargerThan, OrEqualTo
cull_pattern = CullPattern(List=removeduplicatepts, CullPattern=smaller_than.SmallerThan)  # -> graft(List)
cull_pattern_2 = CullPattern(List=removeduplicatepts, CullPattern=larger_than.LargerThan)  # -> graft(List)
point = Point(cull_pattern)
point_2 = Point(cull_pattern_2)
vector_xyz = VectorXYZ(XComponent=0, YComponent=0, ZComponent="-100")  # -> Vector, Length
support = Point(point)
pointload = Point(point_2)
entwine = Entwine(
    Branch03=support,
    Branch04=pointload,
    Branch05=vector_xyz.Vector,
    Branch012=graft(tetrahedralize.Mesh),
    FlattenInputs=True)

number_slider = Slider(16, range=0..100)

# ---- group: Element
data = Data(0)
data_2 = Data(0)

# ---- group: Load
data_3 = Data(0)
data_4 = Data(0)

# ---- group: Cross-Section
data_5 = Data(0)
data_6 = Data(0)

# ---- group: Support
data_7 = Data(0)
data_8 = Data(0)

# ----
number_slider_2 = Slider(20, range=0..100)
number_slider_3 = Slider(5, range=0..10)
number_slider_4 = Slider(5, range=0..10)
unit_x = UnitX(Factor=1)
construct_point = ConstructPoint(XCoordinate=0, YCoordinate=0, ZCoordinate=0)
subtraction = Subtraction(A=number_slider_4, B=1)
series = Series(Start=0, Step=number_slider_3, Count=number_slider_4)
line_sdl = LineSDL(Start=construct_point, Direction=unit_x, Length=number_slider_2)
multiplication = Multiplication(A=number_slider_3, B=subtraction)
unit_y = UnitY(Factor=series)
move = Move(Geometry=line_sdl, Motion=unit_y)  # -> flatten(Geometry), Transform
divide_curve = DivideCurve(Curve=move.Geometry, Count=Slider(3, range=0..10), Kinks=False)  # -> Points, Tangents, Parameters
flip_matrix = FlipMatrix(Data=divide_curve.Points)
shatter = Shatter(Curve=graft(move.Geometry), Parameters=divide_curve.Parameters)
polyline = PolyLine(Vertices=flip_matrix, Closed=False)  # -> flatten(Polyline)
number_slider_5 = Slider(4, range=0..100)
explode = Explode(Curve=polyline, Recursive=True)  # -> Segments, Vertices
series_2 = Series(Start=0, Step=Slider(5, range=0..10), Count=number_slider_5)
merge = Merge(Data1=shatter, Data2=explode.Segments)  # -> flatten(Result)
unit_z = UnitZ(Factor=series_2)
move_2 = Move(Geometry=merge, Motion=graft(unit_z))  # -> simplify(Geometry), Transform
construct_domain = ConstructDomain(DomainStart="0", DomainEnd="90")
subtraction_2 = Subtraction(A=number_slider_5, B=1)
rectangle = Rectangle(Plane=PlaneXY(0, 0, 0), XSize=number_slider_2, YSize=multiplication, Radius=0)  # -> Rectangle, Length
number_slider_6 = Slider(3, range=0..10)
mesh_area = MeshArea(Mesh=rectangle.Rectangle)  # -> Area, Centroid
range = Range(Domain="0", Steps=subtraction_2)
radians = Radians(Degrees=range)
rotate = Rotate(Geometry=move_2.Geometry, Angle=graft(radians), Plane=mesh_area.Centroid)  # -> Geometry, Transform
explode_2 = Explode(Curve=rotate.Geometry, Recursive=True)  # -> simplify(Segments), Vertices
trim_tree = TrimTree(Tree=explode_2.Vertices, Depth=1)
trim_tree_2 = TrimTree(Tree=explode_2.Segments, Depth=1)
cull_duplicates = CullDuplicates(Points=trim_tree, Tolerance=0.1, CullMode=3)  # -> simplify(Points), Indices, Valence
flip_matrix_2 = FlipMatrix(Data=cull_duplicates.Points)
split_tree = SplitTree(Data=cull_duplicates.Points, Masks=flatten("{0}"))  # -> Positive, Negative
polyline_2 = PolyLine(Vertices=flip_matrix_2, Closed=False)
split_tree_2 = SplitTree(Data=trim_tree_2, Masks=flatten("{0}"))  # -> Positive, Negative
geometry = Geometry(split_tree.Negative)
geometry_2 = Geometry(split_tree.Positive)
explode_3 = Explode(Curve=polyline_2, Recursive=True)  # -> Segments, Vertices
geometry_3 = Geometry(split_tree_2.Negative)
merge_2 = Merge(Data1=explode_3.Segments, Data2=geometry_3)  # -> flatten(Result)
colonne = RemoveDuplicateLines(Lines=merge_2, Tolerance=0.01)
vector_xyz_2 = VectorXYZ(XComponent="100", YComponent=0, ZComponent="-100")  # -> Vector, Length
pointload_2 = Point(geometry)
support_2 = Point(geometry_2)
entwine_2 = Entwine(
    Branch01=colonne,
    Branch03=support_2,
    Branch04=pointload_2,
    Branch05=vector_xyz_2.Vector,
    Branch010=pointload_2,
    Branch011="300",
    FlattenInputs=True)

# ----
# Model 4
number_slider_7 = Slider(60, range=0..100)
construct_point_2 = ConstructPoint(XCoordinate=0, YCoordinate=0, ZCoordinate=0)
construct_point_3 = ConstructPoint(XCoordinate=number_slider_7, YCoordinate=0, ZCoordinate=0)
unit_z_2 = UnitZ(Factor=Slider(10, range=0..10))
line = Line(StartPoint=construct_point_2, EndPoint=construct_point_3)
move_3 = Move(Geometry=line, Motion=unit_z_2)  # -> Geometry, Transform
panel = Panel(number_slider_7)
_2d_truss = _2DTruss(CurveA=line, CurveB=move_3.Geometry, Divisions=Slider(5, range=0..10), TrussToggle=0)  # -> PrimaryLines, BraceLines, VerticalLines, StructureNodes
deconstruct_3 = Deconstruct(Point=_2d_truss.StructureNodes)  # -> XComponent, YComponent, ZComponent
deconstruct_4 = Deconstruct(Point=_2d_truss.StructureNodes)  # -> XComponent, YComponent, ZComponent
smaller_than_2 = SmallerThan(FirstNumber=deconstruct_3.XComponent, SecondNumber="0.1")  # -> SmallerThan, OrEqualTo
equality = Equality(FirstNumber=deconstruct_4.XComponent, SecondNumber=panel)  # -> Equality, Inequality
merge_3 = Merge(Data1=_2d_truss.PrimaryLines, Data2=_2d_truss.BraceLines, Data3=_2d_truss.VerticalLines)
cull_pattern_3 = CullPattern(List=_2d_truss.StructureNodes, CullPattern=equality.Equality)  # -> flatten(List)
cull_pattern_4 = CullPattern(List=_2d_truss.StructureNodes, CullPattern=smaller_than_2.SmallerThan)  # -> flatten(List)
vector_xyz_3 = VectorXYZ(XComponent=0, YComponent=0, ZComponent="-100")  # -> Vector, Length
pointload_3 = Point(cull_pattern_3)
support_3 = Point(cull_pattern_4)
beam = Curve(merge_3)
entwine_3 = Entwine(Branch01=beam, Branch03=support_3, Branch04=pointload_3, Branch05=vector_xyz_3.Vector, FlattenInputs=True)

series_3 = Series(Start="0", Step="0.50", Count="2")

# ---- group: Material
data_9 = Data(0)
data_10 = Data(0)

# ---- group: Constraint
data_11 = Data(0)
data_12 = Data(0)

# ----
curve = Curve([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])
truss = Curve([<curve referenced from the Rhino model> x2])

# ----
# Model 2
number_slider_8 = Slider(6, range=0..10)
vector_xyz_4 = VectorXYZ(XComponent=0, YComponent=0, ZComponent=0)  # -> Vector, Length
vector_xyz_5 = VectorXYZ(XComponent=0, YComponent=0, ZComponent=number_slider_8)  # -> Vector, Length
move_4 = Move(Geometry=vector_xyz_4.Vector, Motion=vector_xyz_5.Vector)  # -> Geometry, Transform
line_2 = Line(StartPoint=vector_xyz_4.Vector, EndPoint=move_4.Geometry)
vector_xyz_6 = VectorXYZ(XComponent=0, YComponent=Slider(6, range=-20..20), ZComponent=0)  # -> Vector, Length
vector_xyz_7 = VectorXYZ(XComponent=Slider(0, range=-20..20), YComponent=0, ZComponent=0)  # -> Vector, Length
number = Number("0")
pointload_4 = Point(move_4.Geometry)
pointload_5 = Point(move_4.Geometry)
support_4 = Point(vector_xyz_4.Vector)
beam_2 = Curve(line_2)
columns = Curve(beam_2)
entwine_4 = Entwine(
    Branch01=beam_2,
    Branch03=support_4,
    Branch04=pointload_5,
    Branch05=vector_xyz_6.Vector,
    Branch06=columns,
    Branch07=vector_xyz_7.Vector,
    Branch010=pointload_4,
    Branch011=number,
    FlattenInputs=True)

# ----
# Model 1
number_slider_9 = Slider(10, range=0..40)
number_slider_10 = Slider(20, range=0..40)
mesh_plane = MeshPlane(
    Boundary={Plane=PlaneXY(0, 0, 0), Size=Domain2(u=-10..10, v=-10..10)},
    WidthCount=number_slider_9,
    HeightCount=number_slider_9)  # -> Mesh, Area
shell = Mesh(mesh_plane.Mesh)
combine_clean = CombineClean(Meshes=shell)
mesh_explode = MeshExplode(Mesh=combine_clean, Interpolate=False)  # -> flatten(Faces)
deconstruct_mesh_2 = DeconstructMesh(Mesh=combine_clean)  # -> Vertices, Faces, Colours, Normals
area = Area(Geometry=mesh_plane.Mesh)  # -> Area, Centroid
area_2 = Area(Geometry=mesh_explode)  # -> Area, Centroid
distance = Distance(PointA=area.Centroid, PointB=area_2.Centroid)
bounds = Bounds(Numbers=distance)
meshcorners = MeshCorners(Mesh=combine_clean, Angle=2.35619449)
nakedvertices = NakedVertices(Mesh=mesh_plane.Mesh)  # -> ClothedIndex, NakedIndex, ClothedPts, NakedPts
set_difference = SetDifference(SetA=deconstruct_mesh_2.Vertices, SetB=nakedvertices.NakedPts)
deconstruct_domain = DeconstructDomain(Domain=bounds)  # -> Start, End
vector_xyz_8 = VectorXYZ(XComponent=Slider(17, range=-20..20), YComponent=Slider(20, range=-20..20), ZComponent=Slider(-100, range=-100..20))  # -> Vector, Length
maximum = Maximum(A=deconstruct_domain.Start, B=deconstruct_domain.End)
pointload_6 = Point(set_difference)
support_5 = Point(nakedvertices.NakedPts)
similarity = Similarity(FirstNumber=distance, SecondNumber=maximum, Threshold=Slider(1e-06, range=0..1e-06))  # -> Similarity, AbsoluteDifference
dispatch = Dispatch(List=mesh_explode, DispatchPattern=similarity.Similarity)  # -> ListA, ListB
entwine_5 = Entwine(Branch00=mesh_explode, Branch03=support_5, Branch04=pointload_6, Branch05=vector_xyz_8.Vector, FlattenInputs=True)

explode_4 = Explode(Curve=curve, Recursive=True)  # -> Segments, Vertices
unit_z_3 = UnitZ(Factor=series_3)
triangulate = Triangulate(Mesh=shell)  # -> Mesh, Count
removeduplicatepts_2 = RemoveDuplicatePts(Points=flatten(explode_4.Vertices), Tolerance=0.01)
refine = Refine(Mesh=triangulate.Mesh, Level="0")
vector_xyz_9 = VectorXYZ(XComponent=Slider(11, range=-20..20), YComponent=Slider(11, range=-20..20), ZComponent=0)  # -> Vector, Length
construct_domain_2 = ConstructDomain(DomainStart=Slider(1, range=0..1), DomainEnd=Slider(8, range=0..10))
deconstruct_5 = Deconstruct(Point=removeduplicatepts_2)  # -> XComponent, YComponent, ZComponent
panel_2 = Panel("0.50")
smaller_than_3 = SmallerThan(FirstNumber=deconstruct_5.ZComponent, SecondNumber="1")  # -> SmallerThan, OrEqualTo
series_4 = Series(Start="0", Step="0.50", Count=Slider(3, range=0..10))
value_list = ValueList({"Building": 0, "Shell": 1, "Cantiliver": 2, "Brick esaedro": 3, "Truss": 4, "telaio": 5, "Brick tetraedro": 6, "Building  2": 7, "Building  3": 8}, selected="Building")
addition = Addition(A="25", B=Slider(30, range=0..100))
dispatch_2 = Dispatch(List=removeduplicatepts_2, DispatchPattern=smaller_than_3.SmallerThan)  # -> ListA, ListB
unit_z_4 = UnitZ(Factor=series_4)
vector_xyz_10 = VectorXYZ(XComponent=addition, YComponent=Slider(30, range=0..100), ZComponent=Slider(43, range=0..100))  # -> Vector, Length

# ----
# Model 5
number_slider_11 = Slider(-20, range=-20..20)
vector_xyz_11 = VectorXYZ(XComponent="20", YComponent=0, ZComponent=number_slider_11)  # -> Vector, Length
vector_xyz_12 = VectorXYZ(XComponent=Slider(0, range=-20..20), YComponent=0, ZComponent=0)  # -> Vector, Length
beam_3 = Curve(curve)
support_6 = Point(dispatch_2.ListA)
pointload_7 = Point(dispatch_2.ListB)
entwine_6 = Entwine(
    Branch01=beam_3,
    Branch02=truss,
    Branch03=support_6,
    Branch04=pointload_7,
    Branch05=vector_xyz_11.Vector,
    Branch07=vector_xyz_12.Vector,
    Branch010=pointload_7,
    Branch011=Slider(100, range=0..100),
    FlattenInputs=True)

point_3 = Point(vector_xyz_10.Vector)
line_3 = Line(StartPoint=cull_pattern_2, EndPoint=point_3)
item_index = ItemIndex(List=mesh_explode, Item=dispatch.ListA)
mesh = Mesh(dispatch.ListA)

# ----
# UniaxialMaterial
# Elastic
file_path = FilePath("C:\GitHub\Alpaca4d\PythonScript\Pre-Processing\Material\uniAxialMaterial\ElasticUniaxialMaterial.py")
read_file = ReadFile(File=file_path, PerLineParse=False)
ghpython_script = GhPythonScript(Code=read_file, MatName="S275", E="210000", G="80760", Rho="75", Fy="35")  # -> Out, UniaxialMaterial
ghpython_script_2 = GhPythonScript(x=ghpython_script.UniaxialMaterial)  # -> out, a
# ---------- ghpython_script_2: Python ----------
a = x
# ---------- end ghpython_script_2 ----------
panel_3 = Panel(ghpython_script_2.a)

# ----
# UniaxialMaterial
# Elastic
panel_4 = Panel("210000")
ghpython_script_3 = GhPythonScript(Code=read_file, MatName="S255", E=panel_4, G="80760", Rho="75", Fy="25")  # -> Out, UniaxialMaterial
ghpython_script_4 = GhPythonScript(x=ghpython_script_3.UniaxialMaterial)  # -> out, a; same code as ghpython_script_2
panel_5 = Panel(ghpython_script_4.a)

# ----
# nDMaterial
# ElasticIsotropic
file_path_2 = FilePath("C:\GitHub\Alpaca4d\PythonScript\Pre-Processing\Material\nDMaterial\ElasticIsotropic.py")
read_file_2 = ReadFile(File=file_path_2, PerLineParse=False)
ghpython_script_5 = GhPythonScript(Code=read_file_2, MatName="S275", E="210000", G="80760", Rho="75", Fy="35")  # -> Out, NDMaterial

# ----
# Generic Cross Section
file_path_3 = FilePath("C:\GitHub\Alpaca4d\PythonScript\Pre-Processing\Section\GenericCrossSection.py")
read_file_3 = ReadFile(File=file_path_3, PerLineParse=False)
ghpython_script_6 = GhPythonScript(
    Code=read_file_3,
    SectionName="Generic",
    Area="20",
    Ay="20",
    Az="20",
    Iyy="20",
    Izz="20",
    J="20",
    UniaxialMaterial=ghpython_script.UniaxialMaterial)  # -> Out, CrossSection

file_path_4 = FilePath("C:\GitHub\Alpaca4d\PythonScript\Pre-Processing\Load\BeamLoad.py")

# ----
# WIP
panel_6 = Panel("100")
random = Random(Range="20", Number=panel_6, Seed=2)
random_2 = Random(Range="20", Number=panel_6, Seed="3")
construct_point_4 = ConstructPoint(XCoordinate=random, YCoordinate=random_2, ZCoordinate=0)
ghpython_script_7 = GhPythonScript(Pos=construct_point_4, RigidDiaphragm=Toggle(True))  # -> Out, A

# ----
# Circular CrossSection
file_path_5 = FilePath("C:\GitHub\Alpaca4d\PythonScript\Pre-Processing\Section\CircularCrossSection.py")
read_file_4 = ReadFile(File=file_path_5, PerLineParse=False)
ghpython_script_8 = GhPythonScript(Code=read_file_4, SectionName="CHS", Diameter="400", Thickness="40", UniaxialMaterial=ghpython_script_3.UniaxialMaterial)  # -> Out, CrossSection

read_file_5 = ReadFile(File=file_path_4, PerLineParse=False)

# ----
# Rectangular Cross Section
file_path_6 = FilePath("C:\GitHub\Alpaca4d\PythonScript\Pre-Processing\Section\RectangularCrossSection.py")
read_file_6 = ReadFile(File=file_path_6, PerLineParse=False)
ghpython_script_9 = GhPythonScript(Code=read_file_6, SectionName="RHS", Base="300", Height="300", UniaxialMaterial=ghpython_script.UniaxialMaterial)  # -> Out, CrossSection

# ----
# Elastic Membrane Plate Section
file_path_7 = FilePath("C:\GitHub\Alpaca4d\PythonScript\Pre-Processing\Section\ElasticMembranePlateSection.py")
read_file_7 = ReadFile(File=file_path_7, PerLineParse=False)
ghpython_script_10 = GhPythonScript(Code=read_file_7, SectionName="concreteSlab", Thickness="250", NDMaterial=ghpython_script_5.NDMaterial)  # -> Out, CrossSection

integer = Integer(Toggle(False))
panel_7 = Panel(integer)
ghpython_script_11 = GhPythonScript(Force=Point(0, 0, 0), Moment=Point(0, 0, 0))  # -> flatten(LoadWrapper); inputs Force: Vector3d, Moment: Vector3d, Pos: Point3d
# ---------- ghpython_script_11: Python ----------
"""Generate a point load.
    Inputs:
        Force: Input force vector [kN].
        Moment: Input moment vector [kN].
        Pos: Point to apply the loads.
    Output:
       LoadWrapper: Load element.
       """


from ghpythonlib.componentbase import executingcomponent as component
import Grasshopper, GhPython
import System
import Rhino
import rhinoscriptsyntax as rs

class MyComponent(component):
    
    def RunScript(self, Force, Moment, Pos):
        
        import Rhino.Geometry as rg
        import Grasshopper as gh
        
        def pointLoad(Force, Moment, Pos):
        
            Pos = Pos
            Force = rg.Vector3d(0,0,0) if Force is None else Force                   # Input value in kN ---> Output kN
            Moment = rg.Vector3d(0,0,0) if Moment is None else Moment                 # Input value in kNm ---> Output kNm
            loadType = "pointLoad"
        
            return [[Pos, Force, Moment, loadType]]
        
        checkData = True
        
        if Force is None:
            checkData = False
            msg = "input 'Force' failed to collect data"
            ghenv.Component.AddRuntimeMessage(gh.Kernel.GH_RuntimeMessageLevel.Warning, msg)
        
        if Moment is None:
            checkData = False
            msg = "input 'Moment' failed to collect data"
            ghenv.Component.AddRuntimeMessage(gh.Kernel.GH_RuntimeMessageLevel.Warning, msg)
        
        if Pos is None:
            checkData = False
            msg = "input 'Pos' failed to collect data"
            ghenv.Component.AddRuntimeMessage(gh.Kernel.GH_RuntimeMessageLevel.Warning, msg)
        
        
        if checkData != False:
            LoadWrapper = pointLoad(Force, Moment, Pos)
            return LoadWrapper
# ---------- end ghpython_script_11 ----------
file_path_8 = FilePath("C:\GitHub\Alpaca4d\PythonScript\Pre-Processing\Element\Brick\BbarBrick.py")
read_file_8 = ReadFile(File=file_path_8, PerLineParse=False)

# ---- group: Rectangular Hollow Cross Section
file_path_9 = FilePath("C:\GitHub\Alpaca4d\PythonScript\Pre-Processing\Section\RectangularHollowCrossSection.py")
read_file_9 = ReadFile(File=file_path_9, PerLineParse=False)
ghpython_script_12 = GhPythonScript(
    Code=read_file_9,
    SectionName="RHS",
    Base="300",
    Height="300",
    Thickness="25",
    UniaxialMaterial=ghpython_script.UniaxialMaterial)  # -> Out, CrossSection

# ----
# doubleT CrossSection
file_path_10 = FilePath("C:\GitHub\Alpaca4d\PythonScript\Pre-Processing\Section\doubleTCrossSection.py")
read_file_10 = ReadFile(File=file_path_10, PerLineParse=False)
ghpython_script_13 = GhPythonScript(
    Code=read_file_10,
    SectionName="TT",
    Bsup="300",
    Binf="600",
    H="500",
    Tsup="100",
    Tinf="100",
    Tw="100",
    UniaxialMaterial=ghpython_script_3.UniaxialMaterial)  # -> Out, CrossSection

unit_x_2 = UnitX(Factor=Slider(9, range=0..100))
radians_2 = Radians(Degrees="180")
number_slider_12 = Slider(0.1, range=0..0.1)  # disabled
panel_8 = Panel("21")  # disabled
range_2 = Range(Domain=Domain(0, 1), Steps=10)  # disabled
series_5 = Series(Start=0, Step=number_slider_12, Count=panel_8)  # disabled
panel_9 = Panel("3")  # disabled
panel_10 = Panel("0")  # disabled
pi = Pi(Factor=panel_9)  # disabled
panel_11 = Panel("200")  # disabled
panel_12 = Panel("0")  # disabled
number_slider_13 = Slider(20, range=0..100)  # disabled
construct_domain_3 = ConstructDomain(DomainStart=panel_10, DomainEnd=pi)  # disabled
file_path_11 = FilePath("C:\GitHub\Alpaca4d\PythonScript\Analyses\LinearAnalyses\initializeAnalysis.py")
number_slider_14 = Slider(20, range=0..100)  # disabled
construct_domain_4 = ConstructDomain(DomainStart=panel_12, DomainEnd=panel_11)  # disabled
# solver on folder Static Analyses 3ndf
# solver on folder Static Analyses
file_path_12 = FilePath("C:\GitHub\Alpaca4d\PythonScript\Analyses\openSees_StaticSolver_3ndf\initializeAnalysis_3ndf.py")  # disabled
panel_13 = Panel(file_path_11)
# solver on folder Static Analyses
read_file_11 = ReadFile(File=file_path_11, PerLineParse=False)
read_file_12 = ReadFile(File=file_path_12, PerLineParse=False)  # disabled
range_3 = Range(Domain=construct_domain_3, Steps=number_slider_13)  # disabled
analyze = GhPythonScript()  # -> AlpacaStaticOutput; inputs AlpacaModel: list; disabled
# ---------- analyze: Python ----------
"""Calculate the Static Response of the structure
    Inputs:
        AlpacaModel: Assemble model to perform Static Analyses.
    Output:
       AlpacaStaticOutput: Analysed Alpaca model.
       maxDisplacement: Maximum displacement of structure [mm].
       """


from ghpythonlib.componentbase import executingcomponent as component
import Grasshopper, GhPython
import System
import Rhino
import rhinoscriptsyntax as rs

class MyComponent(component):
    
    def RunScript(self, AlpacaModel):
        
        
        import System
        import os
        import Grasshopper as gh
        
        def InitializeStaticAnalysis(AlpacaModel):
            
            ghFilePath = ghenv.Component.Attributes.Owner.OnPingDocument().FilePath
            workingDirectory = os.path.dirname(ghFilePath) 
            outputFileName = 'openSeesOutputWrapper.txt'
        
            for dirpath, dirnames, filenames in os.walk(workingDirectory):
                for filename in filenames:
                    if filename == outputFileName:
                        file = os.path.join(dirpath,outputFileName)
                        os.remove(file)
        
        
        
            ghFolderPath = os.path.dirname(ghFilePath)
            outputFolder = os.path.join(ghFolderPath,'assembleData')
            wrapperFile = os.path.join( outputFolder,'openSeesModel.txt' )
        
            userObjectFolder = gh.Folders.DefaultUserObjectFolder
            pythonInterpreter = os.path.join(userObjectFolder, r'Alpaca4d\Analyses\WPy64\scripts\winpython.bat')
            fileName = os.path.join(userObjectFolder, r'Alpaca4d\Analyses\LinearAnalyses\openSees_StaticSolver.py')
            
            wrapperFile = '"' + wrapperFile + '"'
            fileName = '"' + fileName + '"'
            
            p = System.Diagnostics.Process()
            p.StartInfo.RedirectStandardOutput = True
            p.StartInfo.RedirectStandardError = True
        
            p.StartInfo.UseShellExecute = False
            p.StartInfo.CreateNoWindow = True
            
            p.StartInfo.FileName = pythonInterpreter
            p.StartInfo.Arguments = fileName + " " + wrapperFile
            p.Start()
            p.WaitForExit()
            
            
            msg = p.StandardError.ReadToEnd()
            ghenv.Component.AddRuntimeMessage(gh.Kernel.GH_RuntimeMessageLevel.Error, msg)
        
        
            ## READ THE OUTPUT FROM THE OPEENSEES_SOLVER
            ## THE ORDER MUST BE THE SAME OF THE OUTPUT LIST IN OpenSeesStaticSolver.py
        
            outputFile = os.path.join(outputFolder, outputFileName)
        
            with open(outputFile, 'r') as f:
                lines = f.readlines()
                nodeDisplacementWrapper = eval( lines[0].strip() )
                reactionWrapper = eval( lines[1].strip() )
                elementOutputWrapper = eval( lines[2].strip() )
                elementLoadWrapper = eval( lines[3].strip() )
                eleForceWrapper = eval( lines[4].strip() )
        
        
            AlpacaLinearStaticOutput = ([nodeDisplacementWrapper,
                                    reactionWrapper,
                                    elementOutputWrapper,
                                    elementLoadWrapper,
                                    eleForceWrapper])
        
            return AlpacaLinearStaticOutput
        
        
        checkData = True
        
        if not AlpacaModel:
            checkData = False
            msg = "input 'AlpacaModel' failed to collect data"
            ghenv.Component.AddRuntimeMessage(gh.Kernel.GH_RuntimeMessageLevel.Warning, msg)
        
        
        if checkData != False:
            AlpacaStaticOutput = InitializeStaticAnalysis(AlpacaModel)
            #maxDisplacement = None
            return AlpacaStaticOutput
# ---------- end analyze ----------
range_4 = Range(Domain=construct_domain_4, Steps=number_slider_14)  # disabled
panel_14 = Panel("0.005")  # disabled
sine = Sine(Value=range_3)  # disabled
arccosine = ArcCosine(Value=range_4)  # disabled
sine_2 = Sine(Value=range_4)  # disabled
panel_15 = Panel("0.08")  # disabled
quick_graph = QuickGraph(sine, SortOrder=0)  # disabled
boolean_toggle = BooleanToggle(True)  # disabled
number_slider_15 = Slider(39, range=0..10000)  # disabled
number_slider_16 = Slider(50, range=0..100)  # disabled
value_list_2 = ValueList({"tx": 0, "ty": 1, "tz": 2, "txyz": 3}, selected="txyz")  # disabled
file_path_13 = FilePath("C:\GitHub\Alpaca4d\PythonScript\Post-Processing\viewGroundAccAnalyses\viewGroundAccAnalyses.py")  # disabled
boolean_toggle_2 = BooleanToggle(False)  # disabled
button = Button()  # disabled
boolean_toggle_3 = BooleanToggle(False)  # disabled
read_file_13 = ReadFile(File=file_path_13, PerLineParse=False)  # disabled
panel_16 = Panel("1.25")  # disabled
panel_17 = Panel("0.15")  # disabled
panel_18 = Panel("2.4")  # disabled
panel_19 = Panel("0.5")  # disabled
panel_20 = Panel("2.25")  # disabled
number_slider_17 = Slider(167, range=0..1000)  # disabled
number_slider_18 = Slider(65, range=0..100)  # disabled

# ---- group: nD Stress Visualisation / spectral
colour_swatch = ColourSwatch(SwatchColor=RGB(67, 136, 247))  # disabled
colour_swatch_2 = ColourSwatch(SwatchColor=RGB(0, 30, 255))  # disabled
colour_swatch_3 = ColourSwatch(SwatchColor=RGB(201, 0, 0))  # disabled
colour_swatch_4 = ColourSwatch(SwatchColor=RGB(240, 69, 7))  # disabled
colour_swatch_5 = ColourSwatch(SwatchColor=RGB(251, 255, 0))  # disabled
colour_swatch_6 = ColourSwatch(SwatchColor=RGB(77, 255, 0))  # disabled
colour_swatch_7 = ColourSwatch(SwatchColor=RGB(0, 153, 28))  # disabled
colour_swatch_8 = ColourSwatch(SwatchColor=RGB(111, 0, 176))  # disabled
merge_4 = Merge(
    Data1=colour_swatch_3,
    Data2=colour_swatch_4,
    Data3=colour_swatch_5,
    Data4=colour_swatch_6,
    Data5=colour_swatch_7,
    Data6=colour_swatch,
    Data7=colour_swatch_2,
    Data8=colour_swatch_8)  # disabled

# ---- group: Shell Stress Visualisation / spectral
colour_swatch_9 = ColourSwatch(SwatchColor=RGB(67, 136, 247))  # disabled
colour_swatch_10 = ColourSwatch(SwatchColor=RGB(0, 30, 255))  # disabled
colour_swatch_11 = ColourSwatch(SwatchColor=RGB(201, 0, 0))  # disabled
colour_swatch_12 = ColourSwatch(SwatchColor=RGB(240, 69, 7))  # disabled
colour_swatch_13 = ColourSwatch(SwatchColor=RGB(251, 255, 0))  # disabled
colour_swatch_14 = ColourSwatch(SwatchColor=RGB(77, 255, 0))  # disabled
colour_swatch_15 = ColourSwatch(SwatchColor=RGB(0, 153, 28))  # disabled
colour_swatch_16 = ColourSwatch(SwatchColor=RGB(111, 0, 176))  # disabled
merge_5 = Merge(
    Data1=colour_swatch_11,
    Data2=colour_swatch_12,
    Data3=colour_swatch_13,
    Data4=colour_swatch_14,
    Data5=colour_swatch_15,
    Data6=colour_swatch_9,
    Data7=colour_swatch_10,
    Data8=colour_swatch_16)  # disabled

# ----
vector_xyz_13 = VectorXYZ(XComponent=0, YComponent=0, ZComponent=0)  # -> Vector, Length; disabled

# ----
# Disp Numerical Ouput
# OK!
# Force component
number_slider_19 = Slider(10, range=0..10)  # disabled
file_path_14 = FilePath("C:\GitHub\Alpaca4d\PythonScript\Post-Processing\beamDisp\beamDisp.py")  # disabled
file_path_15 = FilePath("C:\GitHub\Alpaca4d\PythonScript\Post-Processing\brickDisp\brickDisp.py")  # disabled
file_path_16 = FilePath("C:\GitHub\Alpaca4d\PythonScript\Post-Processing\shellDisp\shellDisp.py")  # disabled
file_path_17 = FilePath("C:\GitHub\Alpaca4d\PythonScript\Post-Processing\nodalDisp\nodalDisp.py")  # disabled
read_file_14 = ReadFile(File=file_path_14, PerLineParse=False)  # disabled
read_file_15 = ReadFile(File=file_path_16, PerLineParse=False)  # disabled
read_file_16 = ReadFile(File=file_path_17, PerLineParse=False)  # disabled
read_file_17 = ReadFile(File=file_path_15, PerLineParse=False)  # disabled

# ---- group: jet
colour_swatch_17 = ColourSwatch(SwatchColor=RGB(0, 81, 255))  # disabled
colour_swatch_18 = ColourSwatch(SwatchColor=RGB(201, 0, 0))  # disabled
colour_swatch_19 = ColourSwatch(SwatchColor=RGB(240, 69, 7))  # disabled
colour_swatch_20 = ColourSwatch(SwatchColor=RGB(251, 255, 0))  # disabled
colour_swatch_21 = ColourSwatch(SwatchColor=RGB(77, 255, 0))  # disabled
colour_swatch_22 = ColourSwatch(SwatchColor=RGB(0, 255, 221))  # disabled
merge_6 = Merge(
    Data1=colour_swatch_18,
    Data2=colour_swatch_19,
    Data3=colour_swatch_20,
    Data4=colour_swatch_21,
    Data5=colour_swatch_22,
    Data6=colour_swatch_17)  # -> reverse(Result); disabled

# ---- group: palette Perù
colour_swatch_23 = ColourSwatch(SwatchColor=RGB(209, 17, 17))  # disabled
colour_swatch_24 = ColourSwatch(SwatchColor=RGB(235, 109, 63))  # disabled
colour_swatch_25 = ColourSwatch(SwatchColor=RGB(158, 53, 219))  # disabled
colour_swatch_26 = ColourSwatch(SwatchColor=RGB(173, 227, 48))  # disabled
colour_swatch_27 = ColourSwatch(SwatchColor=RGB(67, 136, 247))  # disabled
colour_swatch_28 = ColourSwatch(SwatchColor=RGB(0, 30, 255))  # disabled
merge_7 = Merge(
    Data1=colour_swatch_23,
    Data2=colour_swatch_24,
    Data3=colour_swatch_25,
    Data4=colour_swatch_26,
    Data5=colour_swatch_27,
    Data6=colour_swatch_28)  # -> reverse(Result); disabled

# ---- group: hsv
colour_swatch_29 = ColourSwatch(SwatchColor=RGB(0, 30, 255))  # disabled
colour_swatch_30 = ColourSwatch(SwatchColor=RGB(240, 69, 7))  # disabled
colour_swatch_31 = ColourSwatch(SwatchColor=RGB(251, 255, 0))  # disabled
colour_swatch_32 = ColourSwatch(SwatchColor=RGB(77, 255, 0))  # disabled
colour_swatch_33 = ColourSwatch(SwatchColor=RGB(0, 255, 221))  # disabled
colour_swatch_34 = ColourSwatch(SwatchColor=RGB(67, 136, 247))  # disabled
colour_swatch_35 = ColourSwatch(SwatchColor=RGB(135, 0, 176))  # disabled
colour_swatch_36 = ColourSwatch(SwatchColor=RGB(247, 0, 103))  # disabled
merge_8 = Merge(
    Data1=colour_swatch_30,
    Data2=colour_swatch_31,
    Data3=colour_swatch_32,
    Data4=colour_swatch_33,
    Data5=colour_swatch_34,
    Data6=colour_swatch_29,
    Data7=colour_swatch_35,
    Data8=colour_swatch_36)  # disabled

# ---- group: jet
merge_9 = Merge(
    Data1=ColourSwatch(SwatchColor=RGB(201, 0, 0)),
    Data2=ColourSwatch(SwatchColor=RGB(240, 69, 7)),
    Data3=ColourSwatch(SwatchColor=RGB(251, 255, 0)),
    Data4=ColourSwatch(SwatchColor=RGB(77, 255, 0)),
    Data5=ColourSwatch(SwatchColor=RGB(0, 255, 221)),
    Data6=ColourSwatch(SwatchColor=RGB(0, 81, 255)))  # -> reverse(Result)

# ----
ghpython_script_14 = GhPythonScript()  # -> out, a
# ---------- ghpython_script_14: Python ----------
__author__ = "FORMAT"
__version__ = "2020.08.25"

import rhinoscriptsyntax as rs
import Rhino.Geometry as rg

rg.Line
# ---------- end ghpython_script_14 ----------

# ----
# Modal Animate
number_slider_20 = Slider(1, range=0..10)
file_path_18 = FilePath("C:\GitHub\Alpaca4d\PythonScript\Post-Processing\animateModal\animateModal.py")
read_file_18 = ReadFile(File=file_path_18, PerLineParse=False)

value_list_3 = ValueList({"tx": 0, "ty": 1, "tz": 2, "txyz": 3}, selected="txyz")

# ---- group: hsv
merge_10 = Merge(
    Data1=ColourSwatch(SwatchColor=RGB(240, 69, 7)),
    Data2=ColourSwatch(SwatchColor=RGB(251, 255, 0)),
    Data3=ColourSwatch(SwatchColor=RGB(77, 255, 0)),
    Data4=ColourSwatch(SwatchColor=RGB(0, 255, 221)),
    Data5=ColourSwatch(SwatchColor=RGB(67, 136, 247)),
    Data6=ColourSwatch(SwatchColor=RGB(0, 30, 255)),
    Data7=ColourSwatch(SwatchColor=RGB(135, 0, 176)),
    Data8=ColourSwatch(SwatchColor=RGB(247, 0, 103)))

# ----
gradientlibrary = GradientLibrary(gradIndex=11)  # -> colors; inputs gradIndex: Int32
#   port colors: A series of colors to be plugged into the "Ladybug_Legend Parameters" component.
# ---------- gradientlibrary: Python ----------
"""
Preset of gradient colors perfect for Data Visualisation
    Inputs:
        gradIndex: An index refering to one of the following possible gradients:
            0 - Orignal Ladybug
            1 - Nuanced Ladybug
            2 - Multi-colored Ladybug
            3 - Ecotect
            4 - Thermal Comfort Percentage
            5 - Thermal Comfort Colors
            6 - Shade Benefit/Harm
            7 - Shade Harm
            8 - Shade Benefit
            9 - CFD Colors 1
            10 - Radiation Benefit
            11 - Gsa10 Colour
            12 - Gsa9 Colour
    Returns:
        customColors: A series of colors.
"""

ghenv.Component.Name = "Gradient Library"
ghenv.Component.NickName = 'GradientLibrary'
#ghenv.Component.Message = 'GradientLibrary\nWIP'

import scriptcontext as sc
import Grasshopper.Kernel as gh
import System

gradientLibrary = {
        0: [System.Drawing.Color.FromArgb(75, 107, 169), System.Drawing.Color.FromArgb(115, 147, 202), System.Drawing.Color.FromArgb(170, 200, 247), System.Drawing.Color.FromArgb(193, 213, 208), System.Drawing.Color.FromArgb(245, 239, 103), System.Drawing.Color.FromArgb(252, 230, 74), System.Drawing.Color.FromArgb(239, 156, 21), System.Drawing.Color.FromArgb(234, 123, 0), System.Drawing.Color.FromArgb(234, 74, 0), System.Drawing.Color.FromArgb(234, 38, 0)],
        1: [System.Drawing.Color.FromArgb(49,54,149), System.Drawing.Color.FromArgb(69,117,180), System.Drawing.Color.FromArgb(116,173,209), System.Drawing.Color.FromArgb(171,217,233), System.Drawing.Color.FromArgb(224,243,248), System.Drawing.Color.FromArgb(255,255,191), System.Drawing.Color.FromArgb(254,224,144), System.Drawing.Color.FromArgb(253,174,97), System.Drawing.Color.FromArgb(244,109,67), System.Drawing.Color.FromArgb(215,48,39), System.Drawing.Color.FromArgb(165,0,38)],
        2: [System.Drawing.Color.FromArgb(4,25,145), System.Drawing.Color.FromArgb(7,48,224), System.Drawing.Color.FromArgb(7,88,255), System.Drawing.Color.FromArgb(1,232,255), System.Drawing.Color.FromArgb(97,246,156), System.Drawing.Color.FromArgb(166,249,86), System.Drawing.Color.FromArgb(254,244,1), System.Drawing.Color.FromArgb(255,121,0), System.Drawing.Color.FromArgb(239,39,0), System.Drawing.Color.FromArgb(138,17,0)],
        3: [System.Drawing.Color.FromArgb(0,0,255), System.Drawing.Color.FromArgb(53,0,202), System.Drawing.Color.FromArgb(107,0,148), System.Drawing.Color.FromArgb(160,0,95), System.Drawing.Color.FromArgb(214,0,41), System.Drawing.Color.FromArgb(255,12,0), System.Drawing.Color.FromArgb(255,66,0), System.Drawing.Color.FromArgb(255,119,0), System.Drawing.Color.FromArgb(255,173,0), System.Drawing.Color.FromArgb(255,226,0), System.Drawing.Color.FromArgb(255,255,0)],
        4: [System.Drawing.Color.FromArgb(0,0,0), System.Drawing.Color.FromArgb(110,0,153), System.Drawing.Color.FromArgb(255,0,0), System.Drawing.Color.FromArgb(255,255,102), System.Drawing.Color.FromArgb(255,255,255)],
        5: [System.Drawing.Color.FromArgb(0,136,255), System.Drawing.Color.FromArgb(200,225,255), System.Drawing.Color.FromArgb(255,255,255), System.Drawing.Color.FromArgb(255,230,230), System.Drawing.Color.FromArgb(255,0,0)],
        6: [System.Drawing.Color.FromArgb(5,48,97), System.Drawing.Color.FromArgb(33,102,172), System.Drawing.Color.FromArgb(67,147,195), System.Drawing.Color.FromArgb(146,197,222), System.Drawing.Color.FromArgb(209,229,240), System.Drawing.Color.FromArgb(255,255,255), System.Drawing.Color.FromArgb(253,219,199), System.Drawing.Color.FromArgb(244,165,130), System.Drawing.Color.FromArgb(214,96,77), System.Drawing.Color.FromArgb(178,24,43), System.Drawing.Color.FromArgb(103,0,31)],
        7: [System.Drawing.Color.FromArgb(255,255,255), System.Drawing.Color.FromArgb(253,219,199), System.Drawing.Color.FromArgb(244,165,130), System.Drawing.Color.FromArgb(214,96,77), System.Drawing.Color.FromArgb(178,24,43), System.Drawing.Color.FromArgb(103,0,31)],
        8: [System.Drawing.Color.FromArgb(255,255,255), System.Drawing.Color.FromArgb(209,229,240), System.Drawing.Color.FromArgb(146,197,222), System.Drawing.Color.FromArgb(67,147,195), System.Drawing.Color.FromArgb(33,102,172), System.Drawing.Color.FromArgb(5,48,97)],
        9: [System.Drawing.Color.FromArgb(0,16,120), System.Drawing.Color.FromArgb(38,70,160), System.Drawing.Color.FromArgb(5,180,222), System.Drawing.Color.FromArgb(16,180,109), System.Drawing.Color.FromArgb(59,183,35), System.Drawing.Color.FromArgb(143,209,19), System.Drawing.Color.FromArgb(228,215,29), System.Drawing.Color.FromArgb(246,147,17), System.Drawing.Color.FromArgb(243,74,0), System.Drawing.Color.FromArgb(255,0,0)],
        10: [System.Drawing.Color.FromArgb(0,191,48), System.Drawing.Color.FromArgb(255,238,184), System.Drawing.Color.FromArgb(255,0,0)],
        11: [System.Drawing.Color.FromArgb(204,0,71), System.Drawing.Color.FromArgb(255,182,71), System.Drawing.Color.FromArgb(206,255,115), System.Drawing.Color.FromArgb(26,180, 214),System.Drawing.Color.FromArgb(0,0,207)],
        12: [System.Drawing.Color.FromArgb(255, 51, 51), System.Drawing.Color.FromArgb(255, 170, 51), System.Drawing.Color.FromArgb(255, 255, 51), System.Drawing.Color.FromArgb(170, 255, 125), System.Drawing.Color.FromArgb(51, 255, 231), System.Drawing.Color.FromArgb(51, 170, 255), System.Drawing.Color.FromArgb(51,51, 255)]}
colors = gradientLibrary[gradIndex]
# ---------- end gradientlibrary ----------
vector_length = VectorLength()

# ---- group: spectral
merge_11 = Merge(
    Data1=ColourSwatch(SwatchColor=RGB(201, 0, 0)),
    Data2=ColourSwatch(SwatchColor=RGB(240, 69, 7)),
    Data3=ColourSwatch(SwatchColor=RGB(251, 255, 0)),
    Data4=ColourSwatch(SwatchColor=RGB(77, 255, 0)),
    Data5=ColourSwatch(SwatchColor=RGB(0, 153, 28)),
    Data6=ColourSwatch(SwatchColor=RGB(67, 136, 247)),
    Data7=ColourSwatch(SwatchColor=RGB(0, 30, 255)),
    Data8=ColourSwatch(SwatchColor=RGB(111, 0, 176)))

colour_swatch_37 = ColourSwatch(SwatchColor=RGB(67, 136, 247))  # disabled
colour_swatch_38 = ColourSwatch(SwatchColor=RGB(0, 30, 255))  # disabled
colour_swatch_39 = ColourSwatch(SwatchColor=RGB(201, 0, 0))  # disabled
colour_swatch_40 = ColourSwatch(SwatchColor=RGB(240, 69, 7))  # disabled
colour_swatch_41 = ColourSwatch(SwatchColor=RGB(251, 255, 0))  # disabled
colour_swatch_42 = ColourSwatch(SwatchColor=RGB(77, 255, 0))  # disabled
colour_swatch_43 = ColourSwatch(SwatchColor=RGB(0, 153, 28))  # disabled
colour_swatch_44 = ColourSwatch(SwatchColor=RGB(111, 0, 176))  # disabled
merge_12 = Merge(
    Data1=colour_swatch_39,
    Data2=colour_swatch_40,
    Data3=colour_swatch_41,
    Data4=colour_swatch_42,
    Data5=colour_swatch_43,
    Data6=colour_swatch_37,
    Data7=colour_swatch_38,
    Data8=colour_swatch_44)  # disabled

# ----
file_path_19 = FilePath("C:\GitHub\Alpaca4d\PythonScript\function\AlpacaColorMesh.py")  # disabled
# da riguardare per i valori
value_list_4 = ValueList({"8Color": 0, "20Color": 1}, selected="8Color")  # disabled
read_file_19 = ReadFile(File=file_path_19, PerLineParse=False)  # disabled
ghpython_script_15 = GhPythonScript(Code=read_file_19)  # -> Out, Color, Tag, Domain, ColorValue; disabled

curve_2 = Curve()  # disabled
number_slider_21 = Slider(4, range=0..10)  # disabled
boolean_toggle_4 = BooleanToggle(False)  # disabled
ghpython_script_16 = GhPythonScript(Visualise=boolean_toggle_4, Weight=graft(number_slider_21))  # inputs Visualise: Boolean, Crv: list, Color: list; disabled
# ---------- ghpython_script_16: Python ----------
import Rhino as rc
from scriptcontext import sticky as st


if True:
    for k,v in st.items():
        if type(v) is rc.Display.CustomDisplay:
            v.Dispose()
            del st[k]


def customDisplay(toggle,component):
    
    """ Make a custom display that is unique to the component and lives in sticky """
    
    # Make unique name and custom display
    displayGuid = "DomeDisplay_" + str(component.InstanceGuid)
    if displayGuid not in st:
        st[displayGuid] = rc.Display.CustomDisplay(True)
        
    # Clear display each time component runs
    st[displayGuid].Clear()
    
    # Return the display or get rid of it
    if toggle:
        return st[displayGuid]
    else:
        st[displayGuid].Dispose()
        del st[displayGuid]
        return None

cd = customDisplay(True,ghenv.Component)


if Visualise and not ghenv.Component.Hidden:
    for segment,colorList in zip(Crv,Color):
        print( segment )
        for crv, color in zip( segment, colorList ):
            cd.AddLine(crv,color,Weight)
# ---------- end ghpython_script_16 ----------

circle = Circle(Plane=PlaneXY(0, 0, 0), Radius=Slider(10, range=0..10))
mesh_2 = Mesh(circle)
refine_2 = Refine(Mesh=mesh_2, Level="0")
weaverbird_s_naked_boundary = WeaverbirdsNakedBoundary(MeshClosedPolylines=refine_2)
number_slider_22 = Slider(2, range=0..100)
subtraction_3 = Subtraction(A=number_slider_22, B="1")
explode_5 = Explode(Curve=weaverbird_s_naked_boundary, Recursive=True)  # -> Segments, Vertices
series_6 = Series(Start="0", Step="4", Count=number_slider_22)
removeduplicatepts_3 = RemoveDuplicatePts(Points=flatten(explode_5.Vertices), Tolerance=0.01)
series_7 = Series(Start="4", Step="4", Count=subtraction_3)
unit_z_5 = UnitZ(Factor=series_6)
unit_z_6 = UnitZ(Factor=series_7)
move_5 = Move(Geometry=graft(removeduplicatepts_3), Motion=unit_z_5)  # -> simplify(Geometry), Transform
move_6 = Move(Geometry=graft(refine_2), Motion=unit_z_6)  # -> Geometry, Transform
shift_list = ShiftList(List=move_5.Geometry, Shift=1, Wrap=True)
deconstruct_mesh_3 = DeconstructMesh(Mesh=move_6.Geometry)  # -> Vertices, Faces, Colours, Normals
removeduplicatepts_4 = RemoveDuplicatePts(Points=flatten(deconstruct_mesh_3.Vertices), Tolerance=0.01)
deconstruct_6 = Deconstruct(Point=removeduplicatepts_4)  # -> XComponent, YComponent, ZComponent
larger_than_2 = LargerThan(FirstNumber=deconstruct_6.XComponent, SecondNumber="9")  # -> LargerThan, OrEqualTo
cull_pattern_5 = CullPattern(List=removeduplicatepts_4, CullPattern=larger_than_2.LargerThan)  # -> flatten(List)
vincoli = Point(removeduplicatepts_3)
vector_xyz_14 = VectorXYZ(XComponent="-100", YComponent=0, ZComponent=0)  # -> Vector, Length
pointload_8 = Point(cull_pattern_5)
support_7 = Point(vincoli)

cull_nth = CullNth(List=simplify(shift_list), CullFrequency=number_slider_22)
cull_nth_2 = CullNth(List=simplify(move_5.Geometry), CullFrequency=number_slider_22)
mesh_explode_2 = MeshExplode(Mesh=move_6.Geometry, Interpolate=False)

line_4 = Line(StartPoint=cull_nth_2, EndPoint=cull_nth)  # -> flatten(Line)
colonne_2 = RemoveDuplicateLines(Lines=line_4, Tolerance=0.01)
entwine_7 = Entwine(
    Branch00=mesh_explode_2,
    Branch01=colonne_2,
    Branch03=support_7,
    Branch04=pointload_8,
    Branch05=vector_xyz_14.Vector,
    FlattenInputs=True)

rectangle_2 = Rectangle(Plane=PlaneXY(0, 0, 0), XSize="10", YSize="20", Radius=0)  # -> Rectangle, Length
mesh_surface = MeshSurface(Surface=rectangle_2.Rectangle, UCount=number_slider, VCount=number_slider, Overhang=True, Equalize=False)
weaverbird_s_offset_mesh = WeaverbirdsOffsetMesh(MeshCurves=mesh_surface, Distance=graft(series_3), OffsetType=0)
entwine_8 = Entwine(Branch00=mesh_surface, Branch01=weaverbird_s_offset_mesh, FlattenInputs=True)
subtraction_4 = Subtraction(A="10", B="1")
vector_xyz_15 = VectorXYZ(XComponent=0, YComponent=0, ZComponent="-100")  # -> Vector, Length

move_7 = Move(Geometry=mesh_surface, Motion=unit_z_3)  # -> flatten(Geometry), Transform

# ---- group: brith to loft mesh
ghpython_script_17 = GhPythonScript(MeshSeries=move_7.Geometry, color=ColourSwatch(SwatchColor=RGB(4, 0, 255)))  # -> out, simplify(flatten(Brick)); inputs MeshSeries: list of Mesh
# ---------- ghpython_script_17: Python ----------
import Rhino.Geometry as rg

def MeshToShell(Mesh):
    
    Mesh.Unweld(0, True)
    mesh = Mesh.ExplodeAtUnweldedEdges()
    newMesh = []
    elementType = []
    for explodedMesh in mesh:
        newMesh.append(explodedMesh)
    return newMesh 

def brick( MeshList, color ):
    meshExpl = []
    Vertix = []
    elementType = []
    solid = []
    
    for Mesh in MeshList:
        shellWrapper = MeshToShell(Mesh)
        meshExpl.append( shellWrapper )
    for index1 in range(0, len(MeshList)-1):
        for index2 in range(0, len(meshExpl[0])):
            if meshExpl[ index1 ][ index2 ].Vertices.Count == 4:
                
                elementType.append("stdBrick")
                vertix1 = meshExpl[ index1 ][ index2 ].Vertices[0]
                vertix2 = meshExpl[ index1 ][ index2 ].Vertices[1]
                vertix3 = meshExpl[ index1 ][ index2 ].Vertices[2]
                vertix4 = meshExpl[ index1 ][ index2 ].Vertices[3]
                vertix5 = meshExpl[index1 + 1 ][ index2].Vertices[0]
                vertix6 = meshExpl[index1 + 1 ][ index2].Vertices[1]
                vertix7 = meshExpl[index1 + 1 ][ index2].Vertices[2]
                vertix8 = meshExpl[index1 + 1 ][ index2].Vertices[3]
                
                vertix = [ vertix1, vertix2, vertix3, vertix4,
                vertix5, vertix6, vertix7, vertix8 ]
                
                ele = rg.Mesh()
                
                ele.Vertices.Add( vertix1 ) # 0 
                ele.Vertices.Add( vertix2 ) # 1
                ele.Vertices.Add( vertix3 ) # 2
                ele.Vertices.Add( vertix4 ) # 3
                ele.Vertices.Add( vertix5 ) # 4
                ele.Vertices.Add( vertix6 ) # 5
                ele.Vertices.Add( vertix7 ) # 6
                ele.Vertices.Add( vertix8 ) # 7
                
                ele.VertexColors.Add(color)
                ele.VertexColors.Add(color)
                ele.VertexColors.Add(color)
                ele.VertexColors.Add(color)
                ele.VertexColors.Add(color)
                ele.VertexColors.Add(color)
                ele.VertexColors.Add(color)
                ele.VertexColors.Add(color)
    
                
                ele.Faces.AddFace(0, 1, 2, 3) # 0
                ele.Faces.AddFace(4, 5, 6, 7) # 1
                ele.Faces.AddFace(0, 1, 5, 4) # 2
                ele.Faces.AddFace(3, 2, 6, 7) # 3
                ele.Faces.AddFace(1, 5, 6, 2) # 4
                ele.Faces.AddFace(0, 4, 7, 3) # 5
                #ele.IsClosed()
                
            else :
                elementType.append(["FourNodeTetrahedron"]*3)
                
                if meshExpl[ index1 ][ index2 ].Vertices[0] == meshExpl[index1 + 1 ][ index2].Vertices[0] :
                    vertix1 = meshExpl[ index1 ][ index2 ].Vertices[0]
                    vertix2 = meshExpl[ index1 ][ index2 ].Vertices[1]
                    vertix3 = meshExpl[ index1 ][ index2 ].Vertices[2]
                    vertix4 = meshExpl[index1 + 1 ][ index2].Vertices[1]
                    vertix5 = meshExpl[index1 + 1 ][ index2].Vertices[2]
                    
                    vertixEle1 = [ vertix1, vertix2, vertix3, vertix4 ]
                    vertixEle2 = [ vertix1, vertix2, vertix3, vertix2 ]
                    
                    ele1 = rg.Mesh() # Tetrahedron 1
                    ele2 = rg.Mesh() # Tetrahedron 2
                    
                    ele1.Vertices.Add( vertix1 ) # 0 
                    ele1.Vertices.Add( vertix2 ) # 1
                    ele1.Vertices.Add( vertix3 ) # 2 
                    ele1.Vertices.Add( vertix4 ) # 3 
                    
                    ele1.VertexColors.Add(color)
                    ele1.VertexColors.Add(color)
                    ele1.VertexColors.Add(color)
                    ele1.VertexColors.Add(color)
                    
                    ele2.Vertices.Add( vertix1 ) # 0 
                    ele2.Vertices.Add( vertix2 ) # 1 
                    ele2.Vertices.Add( vertix3 ) # 2 
                    ele2.Vertices.Add( vertix2 ) # 3
    
                    ele2.VertexColors.Add(color)
                    ele2.VertexColors.Add(color)
                    ele2.VertexColors.Add(color)
                    ele2.VertexColors.Add(color)
                    
                    ele1.Faces.AddFace(0, 1, 4 ) # 0
                    ele1.Faces.AddFace(0, 1, 3 ) # 1
                    ele1.Faces.AddFace(0, 4, 3 ) # 2
                    ele1.Faces.AddFace(1, 3, 4 ) # 3
                    
                    ele2.Faces.AddFace(0, 1, 3 ) # 0
                    ele2.Faces.AddFace(0, 1, 2 ) # 1
                    ele2.Faces.AddFace(1, 2, 3 ) # 2
                    ele2.Faces.AddFace(0, 2, 3 ) # 3
                    
                    ele = [ ele1, ele2 ]
                    
                else :
                
                    vertix1 = meshExpl[ index1 ][ index2 ].Vertices[0]
                    vertix2 = meshExpl[ index1 ][ index2 ].Vertices[1]
                    vertix3 = meshExpl[ index1 ][ index2 ].Vertices[2]
                    vertix4 = meshExpl[index1 + 1 ][ index2].Vertices[0]
                    vertix5 = meshExpl[index1 + 1 ][ index2].Vertices[1]
                    vertix6 = meshExpl[index1 + 1 ][ index2].Vertices[2]
                    
                    vertixEle1 = [ vertix1, vertix2, vertix3, vertix6 ]
                    vertixEle2 = [ vertix4, vertix5, vertix6, vertix1 ]
                    vertixEle3 = [ vertix5, vertix6, vertix2, vertix1 ]
                    
                    vertix = [ vertixEle1, vertixEle2, vertixEle3 ]
                    
                    ele1 = rg.Mesh() # Tetrahedron 1
                    ele2 = rg.Mesh() # Tetrahedron 2
                    ele3 = rg.Mesh() # Tetrahedron 3
                    
                    ele1.Vertices.Add( vertix1 ) # 0 
                    ele1.Vertices.Add( vertix2 ) # 1
                    ele1.Vertices.Add( vertix3 ) # 2 
                    ele1.Vertices.Add( vertix6 ) # 3 
                    
                    ele1.VertexColors.Add(color)
                    ele1.VertexColors.Add(color)
                    ele1.VertexColors.Add(color)
                    ele1.VertexColors.Add(color)
                    
                    ele2.Vertices.Add( vertix4 ) # 0 
                    ele2.Vertices.Add( vertix5 ) # 1 
                    ele2.Vertices.Add( vertix6 ) # 2 
                    ele2.Vertices.Add( vertix1 ) # 3
    
                    ele2.VertexColors.Add(color)
                    ele2.VertexColors.Add(color)
                    ele2.VertexColors.Add(color)
                    ele2.VertexColors.Add(color)
                    
                    ele3.Vertices.Add( vertix5 ) # 0 
                    ele3.Vertices.Add( vertix6 ) # 1 
                    ele3.Vertices.Add( vertix2 ) # 2 
                    ele3.Vertices.Add( vertix1 ) # 3
                    
                    ele3.VertexColors.Add(color)
                    ele3.VertexColors.Add(color)
                    ele3.VertexColors.Add(color)
                    ele3.VertexColors.Add(color)
                    
                    ele1.Faces.AddFace(0, 1, 2 ) # 0
                    ele1.Faces.AddFace(0, 3, 1 ) # 1
                    ele1.Faces.AddFace(0, 3, 2 ) # 2
                    ele1.Faces.AddFace(1, 3, 2 ) # 3
                    
                    ele2.Faces.AddFace(0, 1, 2 ) # 0
                    ele2.Faces.AddFace(0, 3, 1 ) # 1
                    ele2.Faces.AddFace(0, 3, 2 ) # 2
                    ele2.Faces.AddFace(1, 3, 2 ) # 3
                    
                    ele3.Faces.AddFace(0, 1, 2 ) # 0
                    ele3.Faces.AddFace(0, 3, 1 ) # 1
                    ele3.Faces.AddFace(0, 3, 2 ) # 2
                    ele3.Faces.AddFace(1, 3, 2 ) # 3
                    
                    ele = [ ele1, ele2, ele3 ]
            
            solid.append(ele)
            Vertix.append( vertix )
    return solid, elementType

Brick, type = brick( MeshSeries, color )
# ---------- end ghpython_script_17 ----------

# ----
move_8 = Move(Geometry=graft(ghpython_script_17.Brick), Motion=unit_z_4)  # -> flatten(Geometry), Transform

# ----
# Model 0
number_slider_23 = Slider(-20, range=-20..20)
vector_xyz_16 = VectorXYZ(XComponent=0, YComponent=0, ZComponent=Slider(10, range=-20..20))  # -> Vector, Length
vector_xyz_17 = VectorXYZ(XComponent=0, YComponent=Slider(11, range=-20..20), ZComponent=0)  # -> Vector, Length
pointload_9 = Point([Point(0, 0, 10), Point(5, 0, 10), Point(0, 5, 5), Point(0, 5, 10), Point(0, 0, 5)])
support_8 = Point([Point(0, 0, 0), Point(5, 0, 0), Point(10, 0, 0), Point(15, 0, 0), Point(15, 5, 0), Point(10, 5, 0), Point(5, 5, 0), Point(0, 5, 0)])
shell_2 = Mesh([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])
beam_4 = Curve([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])
truss_2 = Curve([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])
cantiliver = Curve([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])
columns_2 = Curve([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])
vector_xyz_18 = VectorXYZ(XComponent=Slider(0, range=-20..20), YComponent=0, ZComponent=0)  # -> Vector, Length
refine_3 = Refine(Mesh=shell_2, Level="2")
mesh_3 = Mesh(refine_3)
combine_clean_2 = CombineClean(Meshes=mesh_3)
mesh_explode_3 = MeshExplode(Mesh=combine_clean_2, Interpolate=False)  # -> flatten(Faces)

list_length = ListLength(List=pointload_9)
range_5 = Range(Domain=construct_domain_2, Steps=list_length)
multiplication_2 = Multiplication(A=vector_xyz_9.Vector, B=range_5)
custom_preview = CustomPreview(Geometry=support_8, Material=ColourSwatch(SwatchColor=RGB(0, 0, 0)))

entwine_9 = Entwine(
    Branch00=mesh_explode_3,
    Branch01=beam_4,
    Branch02=truss_2,
    Branch03=support_8,
    Branch04=pointload_9,
    Branch05=vector_xyz_16.Vector,
    Branch06=columns_2,
    Branch07=vector_xyz_18.Vector,
    Branch08=cantiliver,
    Branch09=vector_xyz_17.Vector,
    Branch010=pointload_9,
    Branch011=multiplication_2,
    FlattenInputs=True)

deconstruct_mesh_4 = DeconstructMesh(Mesh=ghpython_script_17.Brick)  # -> Vertices, Faces, Colours, Normals
ghpython_script_18 = GhPythonScript(x=ghpython_script_17.Brick)  # -> out, flatten(a); same code as ghpython_script_2
removeduplicatepts_5 = RemoveDuplicatePts(Points=flatten(deconstruct_mesh_4.Vertices), Tolerance=0.01)
deconstruct_7 = Deconstruct(Point=removeduplicatepts_5)  # -> XComponent, YComponent, ZComponent
smaller_than_4 = SmallerThan(FirstNumber=deconstruct_7.XComponent, SecondNumber="0.1")  # -> SmallerThan, OrEqualTo
cull_pattern_6 = CullPattern(List=removeduplicatepts_5, CullPattern=smaller_than_4.SmallerThan)  # -> graft(List)
larger_than_3 = LargerThan(FirstNumber=deconstruct_7.XComponent, SecondNumber=subtraction_4)  # -> LargerThan, OrEqualTo
cull_pattern_7 = CullPattern(List=removeduplicatepts_5, CullPattern=larger_than_3.LargerThan)  # -> graft(List)
point_4 = Point(cull_pattern_7)
support_9 = Point(cull_pattern_6)
pointload_10 = Point(point_4)
entwine_10 = Entwine(
    Branch03=support_9,
    Branch04=pointload_10,
    Branch05=vector_xyz_15.Vector,
    Branch012=ghpython_script_17.Brick,
    FlattenInputs=True)

dispatch_3 = Dispatch(List=removeduplicatepts_5, DispatchPattern=smaller_than_4.SmallerThan)  # -> ListA, ListB

point_5 = Point(dispatch_3.ListA)

stream_filter = StreamFilter(
    Gate=value_list,
    Stream0=entwine_9,
    Stream1=entwine_5,
    Stream2=entwine_4,
    Stream3=entwine_10,
    Stream4=entwine_3,
    Stream5=entwine_6,
    Stream6=entwine,
    Stream7=entwine_7,
    Stream8=entwine_2)
explode_tree = ExplodeTree(Data=stream_filter)  # -> Branch0, Branch1, Branch2, Branch3, Branch4, Branch5, Branch6, Branch7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

pointload_11 = Point(explode_tree.Branch4)
vector = Data(explode_tree.Branch5)

support_10 = Point(explode_tree.Branch3)
shell_3 = Mesh(explode_tree.Branch0)
beam_5 = Curve(explode_tree.Branch1)
truss_3 = Curve(explode_tree.Branch2)

data_13 = Data(explode_tree.Branch6)
vector_2 = Data(explode_tree.Branch7)

data_14 = Data(explode_tree.Branch8)
vector_3 = Data(explode_tree.Branch9)

data_15 = Data(explode_tree.Branch10)
mass = Data(explode_tree.Branch11)

brick = Data(explode_tree.Branch12)

# ----
# Support
file_path_20 = FilePath("C:\GitHub\Alpaca4d\PythonScript\Pre-Processing\Element\Support\Support.py")
boolean_toggle_5 = BooleanToggle(True)
read_file_20 = ReadFile(File=file_path_20, PerLineParse=False)
point_6 = Point(support_10)
ghpython_script_19 = GhPythonScript(
    Code=read_file_20,
    Pos=graft(point_6),
    Tx=boolean_toggle_5,
    Ty=Toggle(True),
    Tz=boolean_toggle_5,
    Rx=boolean_toggle_5,
    Ry=boolean_toggle_5,
    Rz=boolean_toggle_5)  # -> Out, flatten(SupportWrapper)
ghpython_script_20 = GhPythonScript(x=ghpython_script_19.SupportWrapper)  # -> out, a; same code as ghpython_script_2
panel_21 = Panel(ghpython_script_20.a)

# ----
# Linear Load
value_list_5 = ValueList({"LocalAxis": 0, "GlobalAxis": 1}, selected="GlobalAxis")
vector_4 = Vector(vector_2)
curve_3 = Curve(data_13)
ghpython_script_21 = GhPythonScript(Code=read_file_5, Force=vector_4, Element=curve_3, Orientation=value_list_5)  # -> Out, flatten(BeamUniformLoad)

# ----
# Linear Load
value_list_6 = ValueList({"LocalAxis": 0, "GlobalAxis": 1}, selected="GlobalAxis")
vector_5 = Vector(vector_3)
curve_4 = Curve(data_14)
ghpython_script_22 = GhPythonScript(Code=read_file_5, Force=vector_5, Element=curve_4, Orientation=value_list_6)  # -> Out, flatten(BeamUniformLoad)

# ----
# Point Load
file_path_21 = FilePath("C:\GitHub\Alpaca4d\PythonScript\Pre-Processing\Load\PointLoad.py")
read_file_21 = ReadFile(File=file_path_21, PerLineParse=False)
vector_6 = Vector(expr("x*0", Vector(2.518385542, -6.656153768, 0)))
vector_7 = Vector(vector)
point_7 = Point(pointload_11)
ghpython_script_23 = GhPythonScript(Code=read_file_21, Force=vector_7, Moment=vector_6, Pos=point_7)  # -> Out, flatten(LoadWrapper)

# ----
# MassLoad
file_path_22 = FilePath("C:\GitHub\Alpaca4d\PythonScript\Pre-Processing\Load\MassLoad.py")
point_8 = Point(data_15)
number_2 = Number(mass)
read_file_22 = ReadFile(File=file_path_22, PerLineParse=False)
ghpython_script_24 = GhPythonScript(Code=read_file_22, NodalMass=number_2, Pos=point_8)  # -> Out, flatten(Mass)

# ----
# meshToShell
mesh_4 = Mesh(shell_3)
file_path_23 = FilePath("C:\GitHub\Alpaca4d\PythonScript\Pre-Processing\Element\MeshToShell\MeshToShell.py")
read_file_23 = ReadFile(File=file_path_23, PerLineParse=False)
ghpython_script_25 = GhPythonScript(
    Code=read_file_23,
    Mesh=mesh_4,
    Colour=ColourSwatch(SwatchColor=RGB(242, 19, 19)),
    CrossSection=ghpython_script_10.CrossSection)  # -> Out, flatten(ShellWrapper)

triangulate_2 = Triangulate(Mesh=mesh_4)  # -> Mesh, Count
mesh_explode_4 = MeshExplode(Mesh=mesh_4, Interpolate=False)  # -> flatten(Faces)
ghpython_script_26 = GhPythonScript(x=ghpython_script_23.LoadWrapper)  # -> out, a; same code as ghpython_script_2

curve_5 = Curve(truss_3)

# ----
# LineToBeam
file_path_24 = FilePath("C:\GitHub\Alpaca4d\PythonScript\Pre-Processing\Element\LineToBeam\LineToBeam.py")
read_file_24 = ReadFile(File=file_path_24, PerLineParse=False)
curve_6 = Curve(beam_5)
ghpython_script_27 = GhPythonScript(Code=read_file_24, Line=curve_6, CrossSection=ghpython_script_8.CrossSection)  # -> Out, flatten(BeamWrapper)

# ----
# LineToTruss
value_list_7 = ValueList({"Truss": 0, "Beam": 1}, selected="Truss")
colour_swatch_45 = ColourSwatch(SwatchColor=RGB(255, 200, 0))
ghpython_script_28 = GhPythonScript(Code=read_file_24, Line=curve_5, CrossSection=ghpython_script_8.CrossSection, OrientSection="0", BeamType=value_list_7)  # -> Out, flatten(BeamWrapper)

data_16 = Data([ghpython_script_21.BeamUniformLoad, ghpython_script_22.BeamUniformLoad, ghpython_script_23.LoadWrapper])

# ----
# Solid
colour_swatch_46 = ColourSwatch(SwatchColor=RGB(0, 72, 255))
ghpython_script_29 = GhPythonScript(Code=read_file_8, Brick=brick, Colour=colour_swatch_46, NDMaterial=ghpython_script_5.NDMaterial)  # -> Out, flatten(SolidWrapper)

list_item = ListItem(List=ghpython_script_29.SolidWrapper, Index=0, Wrap=True)  # -> Item, Item1
ghpython_script_30 = GhPythonScript(x=list_item.Item)  # -> out, simplify(a); same code as ghpython_script_2
ghpython_script_31 = GhPythonScript(x=ghpython_script_30.a)  # -> out, simplify(a); same code as ghpython_script_2
ghpython_script_32 = GhPythonScript(x=ghpython_script_31.a)  # -> out, simplify(a); same code as ghpython_script_2
merge_13 = Merge(
    Data1=ghpython_script_25.ShellWrapper,
    Data2=ghpython_script_27.BeamWrapper,
    Data3=ghpython_script_28.BeamWrapper,
    Data4=ghpython_script_29.SolidWrapper)
panel_22 = Panel(ghpython_script_32.a)
clean_tree = CleanTree(RemoveNulls=True, RemoveInvalid=True, RemoveEmpty=False, Tree=merge_13)
clean_tree_2 = CleanTree(RemoveNulls=True, RemoveInvalid=True, RemoveEmpty=False, Tree=ghpython_script_19.SupportWrapper)
clean_tree_3 = CleanTree(RemoveNulls=True, RemoveInvalid=True, RemoveEmpty=False, Tree=data_16)
clean_tree_4 = CleanTree(RemoveNulls=True, RemoveInvalid=True, RemoveEmpty=False, Tree=ghpython_script_24.Mass)
relay = Relay([beam_5, curve_5])

# ----
# Assemble
file_path_25 = FilePath("C:\GitHub\Alpaca4d\PythonScript\Pre-Processing\Assemble\Assemble.py")
read_file_25 = ReadFile(File=file_path_25, PerLineParse=False)
ghpython_script_33 = GhPythonScript(
    Code=read_file_25,
    Element=flatten(clean_tree),
    Support=flatten(clean_tree_2),
    Load=flatten(clean_tree_3),
    Mass=flatten(clean_tree_4))  # -> Out, AlpacaModel, MassOfStructure

perp_frame = PerpFrame(Curve=reparameterize(relay), Parameter=Slider(0.6, range=0..1))
move_9 = Move(Geometry=relay, Motion=unit_x_2)  # -> Geometry, Transform
ghpython_script_34 = GhPythonScript(x=relay)  # -> out, simplify(a), origin, v1, v2, v3; inputs x: Curve
# ---------- ghpython_script_34: Python ----------
__author__ = "domy7"
__version__ = "2020.09.11"

import rhinoscriptsyntax as rs
import Rhino.Geometry as rg
import math as mt
import ghpythonlib.components as ghcomp

b = x.PointAtNormalizedLength(0)
c = x.PointAtNormalizedLength(1)

midPoint =  x.PointAtNormalizedLength(0.5)
parameter = x.ClosestPoint(midPoint, 0.01)[1]
perpFrame = ghcomp.PerpFrame( x, parameter )
perpFrame = rg.Curve.PerpendicularFrameAt(x, parameter )[1]
#angle = mt.degrees(90)
#plane[1].Rotate( angle , plane[1].ZAxis, plane[1].Origin )
origin = perpFrame.Origin
v1 = perpFrame.XAxis
v2 = perpFrame.YAxis
v3 = perpFrame.ZAxis

print(  v3  )

vectorTypeColumn = rg.Vector3d( 0.0, 0.0, 1.0 )

if  v3 == vectorTypeColumn :
    v1 = -v1
    #v2 = -v2

else :
    angle = mt.radians(90)
    perpFrame.Rotate( angle , v3, origin )
    v1 = perpFrame.XAxis
    v2 = -perpFrame.YAxis
# ---------- end ghpython_script_34 ----------
move_10 = Move(Geometry=point_6, Motion=unit_x_2)  # -> Geometry, Transform
move_11 = Move(Geometry=point_7, Motion=unit_x_2)  # -> Geometry, Transform
rotate_2 = Rotate(Geometry=perp_frame, Angle=radians_2, Plane=perp_frame)  # -> Geometry, Transform
vector_display_ex = VectorDisplayEx(Point=ghpython_script_34.origin, Vector=ghpython_script_34.v3, Colour=ColourSwatch(SwatchColor=RGB(0, 81, 255)), Width=2)
vector_display_ex_2 = VectorDisplayEx(Point=ghpython_script_34.origin, Vector=ghpython_script_34.v1, Colour=ColourSwatch(SwatchColor=RGB(255, 0, 0)), Width=2)
vector_display_ex_3 = VectorDisplayEx(Point=ghpython_script_34.origin, Vector=ghpython_script_34.v2, Colour=ColourSwatch(SwatchColor=RGB(60, 255, 0)), Width=2)
panel_23 = Panel(ghpython_script_33.MassOfStructure)  # disabled

# ----
# Karamba Model
division = Division(A="400", B=10)
division_2 = Division(A="40", B=10)
cross_section_karamba3d = CrossSectionKaramba3D(
    FamilyNameOfCrossSection="DefaultCroSec",
    Material=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,
    Diameter_cm=division,
    WallThickness_cm=division_2,
    mode="Circular Hollow")
line_to_beam_karamba3d = LineToBeamKaramba3D(
    Line=move_9.Geometry,
    Color=ColourSwatch(SwatchColor=RGB(95, 207, 31)),
    CrossSection=cross_section_karamba3d,
    New=True,
    Remove=True,
    LimitDistance_m=0.005)  # -> Element, Points, Info
support_karamba3d = SupportKaramba3D(PosInd=move_10.Geometry, menu=[buttons(on, on, on, on, on, on)])
loads_karamba3d = LoadsKaramba3D(ForceVector=vector_7, Local=False, PosInd=move_11.Geometry, LCase=0, mode="Point")
assemble_model_karamba3d = AssembleModelKaramba3D(Elem=flatten(line_to_beam_karamba3d.Element), Support=support_karamba3d, Load=loads_karamba3d, LimitDistance_m=0.005)  # -> Model, Info, Mass_kg, CenterOfGravity
analyze_karamba3d = AnalyzeKaramba3D(Model=assemble_model_karamba3d.Model)  # -> CalculatedModel, MaximumDisplacement_cm, ResultingForceOfGravity_kN, ElasticEnergy_kNm
model_view_karamba3d = ModelViewKaramba3D(Model=analyze_karamba3d.CalculatedModel, LoadCaseFactorsForLinearSuperposition=1, IndexOfVisibleLoadcase=-1)  # -> Model, DeformedMesh, DeformedAxes, DeformedModel
beam_view_karamba3d = BeamViewKaramba3D(Model=model_view_karamba3d.Model)  # -> Model, MeshesOfRenderedBeams, DeformedBeamAxes, LegendColors, LegendTags

data_17 = Data(ghpython_script_33.AlpacaModel)  # disabled

# ----
# EarthQuake Analyses
file_path_26 = FilePath("C:\GitHub\Alpaca4d\PythonScript\Analyses\EarthQuakeAnalysis\BM68elc.acc")  # disabled
panel_24 = Panel("1")  # disabled
value_list_8 = ValueList({"x": 1, "y": 2, "z": 3}, selected="x")  # disabled
file_path_27 = FilePath("C:\GitHub\Alpaca4d\PythonScript\Analyses\EarthQuakeAnalysis\initializeEarthQuakeAnalysis.py")  # disabled
panel_25 = Panel("0.01")  # disabled
panel_26 = Panel("1")  # disabled
read_file_26 = ReadFile(File=file_path_27, PerLineParse=False)  # disabled
analyze_2 = GhPythonScript(
    Code=read_file_26,
    AlpacaModel=data_17,
    TmaxAnalyses=panel_26,
    GroundMotionDirection=value_list_8,
    GroundMotionValues=sine,
    GroundMotionTimeStep=series_5,
    GroundMotionFactor=panel_24,
    TimeStepIncrement=panel_14,
    Damping=panel_15,
    NewmarkGamma=0.5,
    NewmarkBeta=0.25)  # -> Out, AlpacaGroundmotionOutput, MaxDisplacement, MinDisplacement; disabled

read_file_27 = ReadFile(File=file_path_26, PerLineParse=False)  # disabled
quick_graph_2 = QuickGraph(sine, SortOrder=0)  # disabled
panel_27 = Panel(" ")  # disabled
text_split = TextSplit(Text=read_file_27, Separators=panel_27)  # disabled
panel_28 = Panel("1")  # disabled
division_3 = Division(A=text_split, B=panel_28)  # disabled
clean_tree_5 = CleanTree(RemoveNulls=True, RemoveInvalid=True, RemoveEmpty=invert(False), Tree=division_3)  # disabled
list_length_2 = ListLength(List=clean_tree_5)  # disabled
multiplication_3 = Multiplication(A=list_length_2, B=panel_25)  # disabled
earthquake_file_seconds = Panel(multiplication_3)  # disabled

analyze_3 = GhPythonScript(Code=read_file_11, AlpacaModel=ghpython_script_33.AlpacaModel)  # -> Out, AlpacaStaticOutput, MaxDisplacement
analyze_4 = GhPythonScript(Code=read_file_12, AlpacaModel=ghpython_script_33.AlpacaModel)  # -> Out, AlpacaStaticOutput; disabled
series_8 = Series(Start=0, Step=panel_25, Count=list_length_2)  # disabled

# ----
# WIP
boolean_toggle_6 = BooleanToggle(True)
data_18 = Data(ghpython_script_33.AlpacaModel)
ghpython_script_35 = GhPythonScript(
    AlpacaModel=data_18,
    Model=boolean_toggle_6,
    Support=Toggle(False),
    Mass=Toggle(False),
    LocalAxis=Toggle(True),
    Load=Toggle(True),
    NodeTag=Toggle(False),
    ElementTag=Toggle(True))  # -> AlpacaModel, Model; inputs AlpacaModel: list, Model: Boolean, Support: Boolean, Mass: Boolean, LocalAxis: Boolean, Load: Boolean, NodeTag: Boolean, ElementTag: Boolean
# ---------- ghpython_script_35: Python ----------
"""Generate Model view 
    Inputs:
        AlpacaModel: Output of Assemble Model.
        Model: True: Visualise the stick Model. Default is False
        ExtrudedModel: True: Visualise the Extruded Model. Default is True
        Support: True: Visualise the Support. Default is True
        Mass: True: Visualise the Concentrated Mass. Default is False
        LocalAxes: True: Visualise the LocalAxis. Default is False
        Load: True: Visualise the Load. Default is False
        NodeTag: True: Visualise the NodeTag. Default is False
        ElementTag: True: Visualise the ElementTag. Default is False
    Output:
        out:
"""

from ghpythonlib.componentbase import executingcomponent as component
import Grasshopper, GhPython
import System
import Rhino
import rhinoscriptsyntax as rs

class VisualiseModellll(component):
    
    def RunScript(self, AlpacaModel, Model, Support, Mass, LocalAxis, Load, NodeTag, ElementTag):
        
        import Rhino.Geometry as rg
        import math as mt
        import ghpythonlib.treehelpers as th
        import Grasshopper as gh
        import rhinoscriptsyntax as rs
        import sys
        import Rhino as rc
        import System.Drawing.Color
        import scriptcontext as sc
        
        
        def VisualiseModel(AlpacaModel, Model, Support, Mass, LocalAxis, Load, NodeTag, ElementTag):
        
            Model = False if Model is None else Model
            Support = True if Support is None else Support
            Mass = False if Mass is None else Mass
            LocalAxis = False if LocalAxis is None else LocalAxis
            Load = False if Load is None else Load
            NodeTag = False if NodeTag is None else NodeTag
            ElementTag = False if ElementTag is None else ElementTag
            
            
            def linspace(a, b, n=100):
                if n < 2:
                    return b
                diff = (float(b) - a)/(n - 1)
                return [diff * i + a  for i in range(n)]
            
            def AddRectangleFromCenter(plane, width, height):
                a = plane.PointAt(-width * 0.5, -height * 0.5 )
                b = plane.PointAt(-width * 0.5,  height * 0.5 )
                c = plane.PointAt( width * 0.5,  height * 0.5 )
                d = plane.PointAt( width * 0.5,  -height * 0.5 )
                #rectangle = rg.PolylineCurve( [a, b, c, d, a] )
                rectangle  = [a, b, c, d] 
                return rectangle
            
            def AddCircleFromCenter( plane, radius):
                t = linspace( 0 , 1.85*mt.pi, 15 )
                a = []
                for ti in t:
                    x = radius*mt.cos(ti)
                    y = radius*mt.sin(ti)
                    a.append( plane.PointAt( x, y ) )
                #circle = rg.PolylineCurve( a )
                circle  = a 
                return circle
            
            def AddIFromCenter(plane, Bsup, tsup, Binf, tinf, H, ta, yg):
                #-------------------1---------2 #
                p1 = plane.PointAt( -(yg - tinf), ta/2 )
                p2 = plane.PointAt( -(yg - tinf), Binf/2 )
                p3 = plane.PointAt( -yg, Binf/2 )
                p4 = plane.PointAt( -yg, -Binf/2 )
                p5 = plane.PointAt( -(yg - tinf), -Binf/2 ) 
                p6 = plane.PointAt( -(yg - tinf), -ta/2 )
                p7 = plane.PointAt( (H - yg - tsup), -ta/2)
                p8 = plane.PointAt( (H - yg - tsup), -Bsup/2 )
                p9 = plane.PointAt( (H - yg ), -Bsup/2 )
                p10 = plane.PointAt( (H - yg ), Bsup/2 )
                p11 = plane.PointAt( (H - yg - tsup), Bsup/2 )
                p12 = plane.PointAt( (H - yg - tsup), ta/2 )
            
                wirframe  = [ p1, p2, p3, p4, p5, p6, p7, p8, p9, p10, p11, p12 ] 
                return wirframe
            
            def ShellQuad( ele, node):
                eleTag = ele[1]
                eleNodeTag = ele[2]
                color = ele[5]
                thick = ele[4]
                index1 = eleNodeTag[0]
                index2 = eleNodeTag[1]
                index3 = eleNodeTag[2]
                index4 = eleNodeTag[3]
                
                ## CREO IL MODELLO  ##
                point1 = node.get( index1 -1 , "never")
                point2 = node.get( index2 -1 , "never")
                point3 = node.get( index3 -1 , "never")
                point4 =  node.get( index4 -1 , "never")
                
                shellModel = rg.Mesh()
                shellModel.Vertices.Add( point1 ) #0
                shellModel.Vertices.Add( point2 ) #1
                shellModel.Vertices.Add( point3 ) #2
                shellModel.Vertices.Add( point4 ) #3
                
                
                shellModel.Faces.AddFace(0, 1, 2, 3)
                colour = rs.CreateColor( color[0], color[1], color[2] )
                shellModel.VertexColors.CreateMonotoneMesh( colour )
            
                vt = shellModel.Vertices
                shellModel.FaceNormals.ComputeFaceNormals()
                fid,MPt = shellModel.ClosestPoint(vt[0],0.01)
                normalFace = shellModel.FaceNormals[fid]
                vectormoltiplicate = rg.Vector3d.Multiply( -normalFace, thick/2 )
                trasl = rg.Transform.Translation( vectormoltiplicate )
                moveShell = rg.Mesh.DuplicateMesh(shellModel)
                moveShell.Transform( trasl )
                extrudeShell = rg.Mesh.Offset( moveShell, thick, True, normalFace)
                
                return  [ shellModel, extrudeShell ] 
            
            def ShellTriangle( ele, node ):
                
                eleTag = ele[1]
                eleNodeTag = ele[2]
                thick = ele[4]
                color = ele[5]
                index1 = eleNodeTag[0]
                index2 = eleNodeTag[1]
                index3 = eleNodeTag[2]
                
                
                ## CREO IL MODELLO DEFORMATO  ##
                point1 =  node.get( index1 -1 , "never")
                point2 =  node.get( index2 -1 , "never")
                point3 =  node.get( index3 -1 , "never")
                
                shellModel = rg.Mesh()
                shellModel.Vertices.Add( point1 ) #0
                shellModel.Vertices.Add( point2 ) #1
                shellModel.Vertices.Add( point3 ) #2
                
                shellModel.Faces.AddFace(0, 1, 2)
                colour = rs.CreateColor( color[0], color[1], color[2] )
                shellModel.VertexColors.CreateMonotoneMesh( colour )
                
                vt = shellModel.Vertices
                shellModel.FaceNormals.ComputeFaceNormals()
                fid,MPt = shellModel.ClosestPoint(vt[0],0.01)
                normalFace = shellModel.FaceNormals[fid]
                vectormoltiplicate = rg.Vector3d.Multiply( -normalFace, thick/2 ) 
                trasl = rg.Transform.Translation( vectormoltiplicate )
                moveShell = rg.Mesh.DuplicateMesh(shellModel)
                moveShell.Transform( trasl )
                extrudeShell = rg.Mesh.Offset( moveShell, thick, True, normalFace)
                
                return  [ shellModel, extrudeShell ]
            
            def Solid( ele, node ):
                
                eleTag = ele[1]
                eleNodeTag = ele[2]
                color = ele[5]
                #print( eleNodeTag )
                index1 = eleNodeTag[0]
                index2 = eleNodeTag[1]
                index3 = eleNodeTag[2]
                index4 = eleNodeTag[3]
                index5 = eleNodeTag[4]
                index6 = eleNodeTag[5]
                index7 = eleNodeTag[6]
                index8 = eleNodeTag[7]
                
                ## CREO IL MODELLO DEFORMATO  ##
                point1 =  node.get( index1 -1 , "never")
                point2 =  node.get( index2 -1 , "never")
                point3 =  node.get( index3 -1 , "never")
                point4 =  node.get( index4 -1 , "never")
                point5 =  node.get( index5 -1 , "never")
                point6 =  node.get( index6 -1 , "never")
                point7 =  node.get( index7 -1 , "never")
                point8 =  node.get( index8 -1 , "never")
                #print( type(pointDef1) ) 
                shellDefModel = rg.Mesh()
                shellDefModel.Vertices.Add( point1 ) #0
                shellDefModel.Vertices.Add( point2 ) #1
                shellDefModel.Vertices.Add( point3 ) #2
                shellDefModel.Vertices.Add( point4 ) #3
                shellDefModel.Vertices.Add( point5 ) #4
                shellDefModel.Vertices.Add( point6 ) #5
                shellDefModel.Vertices.Add( point7 ) #6
                shellDefModel.Vertices.Add( point8 ) #7
            
                shellDefModel.Faces.AddFace(0, 1, 2, 3)
                shellDefModel.Faces.AddFace(4, 5, 6, 7)
                shellDefModel.Faces.AddFace(0, 1, 5, 4)
                shellDefModel.Faces.AddFace(1, 2, 6, 5)
                shellDefModel.Faces.AddFace(2, 3, 7, 6)
                shellDefModel.Faces.AddFace(3, 0, 4, 7)
                
                colour = rs.CreateColor( color[0], color[1], color[2] )
                shellDefModel.VertexColors.CreateMonotoneMesh( colour )
                return  shellDefModel
            
            def TetraSolid( ele, node ):
                
                eleTag = ele[1]
                eleNodeTag = ele[2]
                color = ele[5]
                #print( eleNodeTag )
                index1 = eleNodeTag[0]
                index2 = eleNodeTag[1]
                index3 = eleNodeTag[2]
                index4 = eleNodeTag[3]
                
                ## CREO IL MODELLO DEFORMATO  ##
                point1 =  node.get( index1 -1 , "never")
                point2 =  node.get( index2 -1 , "never")
                point3 =  node.get( index3 -1 , "never")
                point4 =  node.get( index4 -1 , "never")
                
                #print( type(pointDef1) )
                
                shellDefModel = rg.Mesh()
                shellDefModel.Vertices.Add( point1 ) #0
                shellDefModel.Vertices.Add( point2 ) #1
                shellDefModel.Vertices.Add( point3 ) #2
                shellDefModel.Vertices.Add( point4 ) #3
                
                
                shellDefModel.Faces.AddFace( 0, 1, 2 )
                shellDefModel.Faces.AddFace( 0, 1, 3 )
                shellDefModel.Faces.AddFace( 1, 2, 3 )
                shellDefModel.Faces.AddFace( 0, 2, 3 )
                colour = rs.CreateColor( color[0], color[1], color[2], 0 )
                shellDefModel.VertexColors.CreateMonotoneMesh( colour )
                
                return  shellDefModel
            
            def Beam( ele, node):
                TagEle = ele[1]
                indexStart = ele[2][0]
                indexEnd = ele[2][1]
                color = ele[16]
                dimSection = ele[14]
                pointStart = node.get( indexStart  , "never")
                pointEnd = node.get( indexEnd  , "never")
                line = rg.LineCurve( pointStart, pointEnd )
                axis1 =  rg.Vector3d( ele[13][0][0], ele[13][0][1], ele[13][0][2]  )
                axis2 =  rg.Vector3d( ele[13][1][0], ele[13][1][1], ele[13][1][2]  )
                axis3 =  rg.Vector3d( ele[13][2][0], ele[13][2][1], ele[13][2][2]  )
                versor = [ axis1, axis2, axis3 ] 
                
                planeStart = rg.Plane(pointStart, axis1, axis2)
                planeEnd = rg.Plane(pointEnd, axis1, axis2)
                plane = [ planeStart, planeEnd ]
                
                sectionForm = []
                sectionPolyline = []
                for sectionPlane in plane:
                    
                    if dimSection[0] == 'rectangular' :
                        width, height = dimSection[1], dimSection[2]
                        section = AddRectangleFromCenter( sectionPlane, width, height )
                        sectionForm.append( section )
                    elif dimSection[0] == 'circular' :
                        radius1  = dimSection[1]/2
                        radius2  = dimSection[1]/2 - dimSection[2]
                        section1 = AddCircleFromCenter( sectionPlane, radius1 )
                        section2 = AddCircleFromCenter( sectionPlane, radius2 )
                        sectionForm.append( [ section1, section2 ] )
                    elif dimSection[0] == 'doubleT' :
                        Bsup = dimSection[1]
                        tsup = dimSection[2]
                        Binf = dimSection[3]
                        tinf = dimSection[4]
                        H =  dimSection[5]
                        ta =  dimSection[6]
                        yg =  dimSection[7]
                        section = AddIFromCenter( sectionPlane, Bsup, tsup, Binf, tinf, H, ta, yg )
                        sectionForm.append( section )
                    elif dimSection[0] == 'rectangularHollow' :
                        width, height, thickness = dimSection[1], dimSection[2], dimSection[3]
                        section1 = AddRectangleFromCenter( sectionPlane, width, height )
                        section2 = AddRectangleFromCenter( sectionPlane, width - (2*thickness), height - (2*thickness) )
                        sectionForm.append( [ section1, section2 ] )
                    elif dimSection[0] == 'Generic' :
                        radius  = dimSection[1]
                        section = AddCircleFromCenter( sectionPlane, radius )
                        sectionForm.append( section )
                    #print(sectionForm)
            
                colour = rs.CreateColor( color[0], color[1], color[2] )
            
                if dimSection[0] == 'circular' :
                    sectionForm1 = [row[0] for row in sectionForm ]
                    sectionForm2 = [row[1] for row in sectionForm ]
                    meshExtr = meshLoft3( sectionForm1,  color )
                    meshExtr.Append( meshLoft3( sectionForm2,  color ) )
                    sectionStartEnd = [ [sectionForm1[0], sectionForm2[0]], [sectionForm1[-1], sectionForm2[-1]]  ]
                    for iSection in sectionStartEnd :
                        iMesh = rg.Mesh()
                        for iPoint, jPoint in zip(iSection[0],iSection[1])  :
                            iMesh.Vertices.Add( iPoint )
                            iMesh.Vertices.Add( jPoint )
                        for i in range(0,len(iSection[0]) - 1): # sistemare
                            index1 = i*2 # 0
                            index2 = index1 + 1 #1
                            index3 = index1 + 3 #2
                            index4 = index1 + 2 #3
                            iMesh.Faces.AddFace(index1, index2, index3, index4)
                        iMesh.Faces.AddFace(index4, index3, 1, 0)
                        iMesh.VertexColors.CreateMonotoneMesh( colour )
                        meshExtr.Append( iMesh )
                        #meshExtr.IsClosed()
                elif  dimSection[0] == 'rectangular' : 
                    meshExtr = meshLoft3( sectionForm,  color )
                    sectionStartEnd = [ sectionForm[0], sectionForm[-1] ]
                    for iSection in sectionStartEnd :
                        iMesh = rg.Mesh()
                        for iPoint in iSection :
                             iMesh.Vertices.Add( iPoint )
                        iMesh.Faces.AddFace(0, 1, 2, 3)
                        iMesh.VertexColors.CreateMonotoneMesh( colour )
                        meshExtr.Append( iMesh )
                elif  dimSection[0] == 'doubleT' : 
                    meshExtr = meshLoft3( sectionForm,  color )
                    sectionStartEnd = [ sectionForm[0], sectionForm[-1] ]
                    for iSection in sectionStartEnd :
                        iMesh = rg.Mesh()
                        for iPoint in iSection :
                             iMesh.Vertices.Add( iPoint )
                        iMesh.Faces.AddFace( 0, 1, 2 )
                        iMesh.Faces.AddFace(2, 3, 5, 0 )
                        iMesh.Faces.AddFace( 3, 4, 5 )
                        iMesh.Faces.AddFace( 5, 6, 11, 0 )
                        iMesh.Faces.AddFace( 6, 7, 8 )
                        iMesh.Faces.AddFace( 8, 9, 11, 6 )
                        iMesh.Faces.AddFace( 9, 10, 11 )
                        #iMesh.Faces.AddFace(3, 2, 1, 4)
                        #iMesh.Faces.AddFace( 5, 6, 11, 0 )
                        #iMesh.Faces.AddFace(7, 8, 9, 10)
                        iMesh.VertexColors.CreateMonotoneMesh( colour )
                        meshExtr.Append( iMesh ) 
                elif  dimSection[0] == 'rectangularHollow' : 
                    sectionForm1 = [row[0] for row in sectionForm ]
                    sectionForm2 = [row[1] for row in sectionForm ]
                    meshExtr = meshLoft3( sectionForm1,  color )
                    meshExtr.Append( meshLoft3( sectionForm2,  color ) )
                    sectionStartEnd = [ [sectionForm1[0], sectionForm2[0]], [sectionForm1[-1], sectionForm2[-1]]  ]
                    for iSection in sectionStartEnd :
                        iMesh = rg.Mesh()
                        for iPoint, jPoint in zip(iSection[0],iSection[1])  :
                            iMesh.Vertices.Add( iPoint )
                            iMesh.Vertices.Add( jPoint )
                        iMesh.Faces.AddFace(0, 1, 3, 2)
                        iMesh.Faces.AddFace(2, 3, 5, 4)
                        iMesh.Faces.AddFace(4, 5, 7, 6)
                        iMesh.Faces.AddFace(6, 7, 1, 0)
                        iMesh.VertexColors.CreateMonotoneMesh( colour )
                        meshExtr.Append( iMesh )
                        #meshExtr.IsClosed()
            
                elif dimSection[0] == 'Generic' :
                    meshExtr = meshLoft3( sectionForm,  color )
            
                return [ line, meshExtr, colour ]
            
            def meshLoft3( point, color ):
                #print( point )
                meshEle = rg.Mesh()
                pointSection1 = point
                for i in range(0,len(pointSection1)):
                    for j in range(0, len(pointSection1[0])):
                        vertix = pointSection1[i][j]
                        #print( type(vertix) )
                        meshEle.Vertices.Add( vertix ) 
                        #meshEle.VertexColors.Add( color[0],color[1],color[2] );
                k = len(pointSection1[0])
                for i in range(0,len(pointSection1)-1):
                    for j in range(0, len(pointSection1[0])):
                        if j < k-1:
                            index1 = i*k + j
                            index2 = (i+1)*k + j
                            index3 = index2 + 1
                            index4 = index1 + 1
                        elif j == k-1:
                            index1 = i*k + j
                            index2 = (i+1)*k + j
                            index3 = (i+1)*k
                            index4 = i*k
                        meshEle.Faces.AddFace(index1, index2, index3, index4)
                        #rs.ObjectColor(scyl,(255,0,0))
                colour = rs.CreateColor( color[0], color[1], color[2] )
                meshEle.VertexColors.CreateMonotoneMesh( colour )
                meshElement = meshEle
                
                return meshElement
            
            def AddBoxFromCenter(plane, width, height):
                a = plane.PointAt(-width * 0.5, -width * 0.5 )
                b = plane.PointAt(-width * 0.5,  width * 0.5 )
                c = plane.PointAt( width * 0.5,  width * 0.5 )
                d = plane.PointAt( width * 0.5,  -width * 0.5 )
                rectangle1 = rg.Brep.CreateFromCornerPoints( a, b, c, d, 0.01)
                box = rg.Brep.CreateOffsetBrep( rectangle1, height, True, True, 0.01 )
                return box
            
            def AddForm1Center(plane, width, height):
                surf = rg.Brep()
                a = plane.PointAt(-width * 0.25, -width * 0.25 )
                b = plane.PointAt(-width * 0.25,  width * 0.25 )
                c = plane.PointAt( width * 0.25,  width * 0.25 )
                d = plane.PointAt( width * 0.25,  -width * 0.25 )
                rectangle1 = rg.Brep.CreateFromCornerPoints( a, b, c, d, 0.01)
                rectangleCurve1 = rg.PolylineCurve( [ a, b, c, d, a] )
                e = plane.PointAt(-width * 0.5, -width * 0.5 )
                f = plane.PointAt(-width * 0.5,  width * 0.5 )
                g = plane.PointAt( width * 0.5,  width * 0.5 )
                h = plane.PointAt( width * 0.5,  -width * 0.5 )
                rectangle2 = rg.Brep.CreateFromCornerPoints( e, f, g, h, 0.01)
                rectangleCurve2 = rg.PolylineCurve( [ e, f, g, h, e] )
                vectorMove = rg.Vector3d( 0, 0, -height )
                trasl = rg.Transform.Translation( vectorMove )
                rectangle2.Transform( trasl )
                rectangleCurve2.Transform( trasl )
                surf.Append( rectangle1 )
                surf.Append( rectangle2 )
                pyramidTrunk = rg.Brep.CreateFromLoft( [ rectangleCurve1, rectangleCurve2 ], rg.Point3d.Unset, rg.Point3d.Unset, rg.LoftType.Straight, False )
                for pyramid in pyramidTrunk:
                    surf.Append( pyramid )
                return  surf 
            
            def AddForm2Center(plane, width, height):
                surf = rg.Brep()
                a = plane.PointAt(-width * 0.5, -width * 0.25 )
                b = plane.PointAt(-width * 0.5,  width * 0.25 )
                c = plane.PointAt( width * 0.5,  width * 0.25 )
                d = plane.PointAt( width * 0.5,  -width * 0.25 )
                rectangle1 = rg.Brep.CreateFromCornerPoints( a, b, c, d, 0.01)
                rectangleCurve1 = rg.PolylineCurve( [ a, b, c, d, a] )
                e = plane.PointAt(-width * 0.5, -width * 0.5 )
                f = plane.PointAt(-width * 0.5,  width * 0.5 )
                g = plane.PointAt( width * 0.5,  width * 0.5 )
                h = plane.PointAt( width * 0.5,  -width * 0.5 )
                rectangle2 = rg.Brep.CreateFromCornerPoints( a, b, c, d, 0.01)
                rectangleCurve2 = rg.PolylineCurve( [ e, f, g, h, e] )
                vectorMove = rg.Vector3d( 0, 0, -height )
                trasl = rg.Transform.Translation( vectorMove )
                rectangle2.Transform( trasl )
                rectangleCurve2.Transform( trasl )
                surf.Append( rectangle1 )
                surf.Append( rectangle2 )
                pyramidTrunk = rg.Brep.CreateFromLoft( [ rectangleCurve1, rectangleCurve2 ], rg.Point3d.Unset, rg.Point3d.Unset, rg.LoftType.Straight, False )
                for pyramid in pyramidTrunk:
                    surf.Append( pyramid )
                return  surf 
            
            def AddForm3Center(plane, width, height):
                surf = rg.Brep()
                a = plane.PointAt(-width * 0.25, -width * 0.5 )
                b = plane.PointAt(-width * 0.25,  width * 0.5 )
                c = plane.PointAt( width * 0.25,  width * 0.5 )
                d = plane.PointAt( width * 0.25,  -width * 0.5 )
                rectangle1 = rg.Brep.CreateFromCornerPoints( a, b, c, d, 0.01)
                rectangleCurve1 = rg.PolylineCurve( [ a, b, c, d, a] )
                e = plane.PointAt(-width * 0.5, -width * 0.5 )
                f = plane.PointAt(-width * 0.5,  width * 0.5 )
                g = plane.PointAt( width * 0.5,  width * 0.5 )
                h = plane.PointAt( width * 0.5,  -width * 0.5 )
                rectangle2 = rg.Brep.CreateFromCornerPoints( a, b, c, d, 0.01)
                rectangleCurve2 = rg.PolylineCurve( [ e, f, g, h, e] )
                vectorMove = rg.Vector3d( 0, 0, -height )
                trasl = rg.Transform.Translation( vectorMove )
                rectangle2.Transform( trasl )
                rectangleCurve2.Transform( trasl )
                surf.Append( rectangle1 )
                surf.Append( rectangle2 )
                pyramidTrunk = rg.Brep.CreateFromLoft( [ rectangleCurve1, rectangleCurve2 ], rg.Point3d.Unset, rg.Point3d.Unset, rg.LoftType.Straight, False )
                for pyramid in pyramidTrunk:
                    surf.Append( pyramid )
                return  surf 
            
            
            #---------------------------------------------------------------------------------------#
            
            
            nodeWrapper = AlpacaModel[0]
            GeomTransf = AlpacaModel[1]
            openSeesBeam = AlpacaModel[2]
            openSeesSupport = AlpacaModel[3]
            openSeesNodeLoad = AlpacaModel[4]
            openSeesNodalMass = AlpacaModel[5]
            openSeesBeamLoad = AlpacaModel[6]
            openSeesShell = AlpacaModel[8]
            openSeesSolid = AlpacaModel[10]
            
            
            
            #######
            ####### NodeTag
            #######
            
            pointWrapper = []
            for item in nodeWrapper:
                point = rg.Point3d(item[1],item[2],item[3])
                pointWrapper.append( [item[0], point ] )
            
            ## Dict. for point ##
            pointWrapperDict = dict( pointWrapper )
            
            posTag = [row[1] for row in pointWrapper ]
            nodeTag = [row[0] for row in pointWrapper ]
            
            """
            if NodeTag:
                self.posTag = posTag
                self.nodeTag = nodeTag
                cameraX = sc.doc.Views.ActiveView.ActiveViewport.CameraX
                cameraY = sc.doc.Views.ActiveView.ActiveViewport.CameraY
                for pos, index in zip(posTag, nodeTag):
                    cd.AddText( rc.Display.Text3d( str(index) , rc.Geometry.Plane(pos, cameraX, cameraY) , 0.3 )    ,  System.Drawing.Color.Black)
            """
            
            model = []
            extrudedModel = []
            line = []
            colorLine = []
            shellVisualise = []
            
            eleTag = []
            posEleTag = []
            for ele in openSeesBeam :
                eleTag.append(ele[1])
                beamModel = Beam( ele, pointWrapperDict )
                line.append( beamModel[0] )
                posEleTag.append( beamModel[0].PointAtNormalizedLength(0.5) )
                colorLine.append( beamModel[2] )
                model.append([ ele[1], beamModel[0] ])
                extrudedModel.append([ ele[1], beamModel[1] ])
            
            for ele in openSeesShell :
                nNode = len( ele[2] )
                eleTag.append( ele[1] )
                if nNode == 4 :
                    shellModel = ShellQuad( ele, pointWrapperDict )
                    calcPropSection = rg.AreaMassProperties.Compute( shellModel[0], False, True, False, False )
                    centroid = calcPropSection.Centroid
                    posEleTag.append( centroid )
                elif nNode == 3:
                    #print( nNode )
                    shellModel = ShellTriangle( ele, pointWrapperDict )
                    calcPropSection = rg.AreaMassProperties.Compute( shellModel[0], False, True, False, False )
                    centroid = calcPropSection.Centroid
                    posEleTag.append( centroid )
                
                shellVisualise.append(shellModel[0])
                model.append([ ele[1] ,shellModel[0] ])
                extrudedModel.append([ ele[1],shellModel[1] ])
            
            
            
            brickVisualise = []
            for ele in openSeesSolid :
                nNode = len( ele[2] )
                eleTag.append( ele[1] )
                eleType = ele[0] 
                if nNode == 8:
                    solidModel = Solid( ele, pointWrapperDict )
                    calcPropSection = rg.AreaMassProperties.Compute( solidModel, False, True, False, False )
                    centroid = calcPropSection.Centroid
                    posEleTag.append( centroid )
                elif  eleType == 'FourNodeTetrahedron' :
                    #print(ele)
                    solidModel = TetraSolid( ele, pointWrapperDict )
                    calcPropSection = rg.AreaMassProperties.Compute( solidModel, False, True, False, False )
                    centroid = calcPropSection.Centroid
                    posEleTag.append( centroid )
                brickVisualise.append(solidModel)
            
                model.append([ ele[1], solidModel ])
                extrudedModel.append([ ele[1], solidModel ])
            
            
            
            #######
            ####### ElementTag
            #######
            
            
            tagEle = th.list_to_tree( [ posEleTag, eleTag ]  )
            """
            if ElementTag:
                for pos, index in zip(posEleTag, eleTag):
                    cameraX = sc.doc.Views.ActiveView.ActiveViewport.CameraX
                    cameraY = sc.doc.Views.ActiveView.ActiveViewport.CameraY
                    cd.AddText( rc.Display.Text3d( str(index) , rc.Geometry.Plane(pos, cameraX, cameraY)  , 0.3 )    ,  System.Drawing.Color.Red)
            """
            
            # --------------------------------#
            modelDict = dict( model )
            modelExstrudedDict = dict( extrudedModel )
            ModelView = []
            ModelViewExtruded = []
            for i in range(0,len(modelDict)):
                ModelView.append( modelDict.get( i  , "never" ))
                ModelViewExtruded.append( modelExstrudedDict.get( i , "never" ))
            
            #--------------------------------#
            
            
            lineModel = th.list_to_tree( [ line, colorLine ]  )
            
            #######
            ####### LocalAxis
            #######
            
            
            midPoint = []
            v3Display = []
            v2Display = []
            v1Display = []
            versorLine = []
            
            for ele in openSeesBeam :
                tag = ele[1]
                indexStart = ele[2][0]
                indexEnd = ele[2][1]
                propSection = ele[13]
                ## creo la linea ##
                lineAxis = rg.LineCurve( pointWrapperDict.get( indexStart  , "never"), pointWrapperDict.get( indexEnd  , "never"))
                MidPoint =  lineAxis.PointAtNormalizedLength(0.5)
                ## creo i versori  ##
                axis1 =  rg.Vector3d( ele[13][0][0], ele[13][0][1], ele[13][0][2]  )
                axis2 =  rg.Vector3d( ele[13][1][0], ele[13][1][1], ele[13][1][2]  )
                axis3 =  rg.Vector3d( ele[13][2][0], ele[13][2][1], ele[13][2][2]  )
                versor = [ axis1, axis2, axis3 ] 
                versorLine.append( [ tag ,versor ]  )
                midPoint.append( MidPoint )
                v3Display.append( axis3 )
                v2Display.append( axis2  )
                v1Display.append( axis1  )
            
            
            VersorLine = dict( versorLine )
            
            
            if LocalAxis:
                self.midPoint = midPoint
                self.v1Display = v1Display
                self.v2Display = v2Display
                self.v3Display = v3Display
            else:
                self.midPoint = []
                self.v1Display = []
                self.v2Display = []
                self.v3Display = []
            
            #######
            ####### Force
            #######
            
            forceMax = []
            for force in openSeesNodeLoad :
                forceVector =  rg.Vector3d( force[1][0], force[1][1] , force[1][2]  )
                fmax = max( forceVector.X, forceVector.Y, forceVector.Z )
                fmin = min( forceVector.X, forceVector.Y, forceVector.Z )
                forceMax.append( max( [ fmax, mt.fabs(fmin) ] ) )
            
            
            for linearLoad in openSeesBeamLoad :
                forceVector =  rg.Vector3d( linearLoad[1][0], linearLoad[1][1] , linearLoad[1][2]  )
                fmax = max( forceVector.X, forceVector.Y, forceVector.Z )
                fmin = min( forceVector.X, forceVector.Y, forceVector.Z )
                forceMax.append( max( [ fmax, mt.fabs(fmin) ] ) )
            
            #print( forceMax )
            forceMin = min( forceMax )
            
            
            #scale = forceMax*0.1/coordMax 
            if forceMin > 0 :
                scale = 1/forceMin 
            else :
                scale = 0.1
            
            forceDisplay = []
            ancorPoint = []
            
            for force in openSeesNodeLoad :
                index = force[0]
                pos = pointWrapperDict.get( index  , "never") 
                forceVector =  rg.Vector3d( force[1][0], force[1][1] , force[1][2]  )
                ancorPoint.append( pos )
                forceDisplay.append(  forceVector*scale  )
                print(ancorPoint)
                print(forceDisplay)
                
            for linearLoad in openSeesBeamLoad :
                tag =  linearLoad[0]
                geomTransf = VersorLine.get( tag  , "never" )
                force1 = rg.Vector3d.Multiply( linearLoad[1][0], geomTransf[0] )
                force2 = rg.Vector3d.Multiply( linearLoad[1][1], geomTransf[1] )
                force3 = rg.Vector3d.Multiply( linearLoad[1][2], geomTransf[2] )
                forceVector =  rg.Vector3d.Multiply( force1 + force2 + force3, scale )
                lineBeam =  modelDict.get( tag  , "never" )
                Length = rg.Curve.GetLength( lineBeam )
                divideDistance = 0.5
                DivCurve = lineBeam.DivideByLength( divideDistance, True )
                if DivCurve == None:
                    DivCurve = [ 0, Length]
            
                for index, x in enumerate(DivCurve):
                    beamPoint = lineBeam.PointAt(DivCurve[index]) 
                    ancorPoint.append( beamPoint )
                    forceDisplay.append( forceVector )
                
            #######
            ####### Mass
            #######
            
            if len(openSeesNodalMass)>0:
                scaleMass  = max([row[1][0] for row in openSeesNodalMass ])
            else:
                scaleMass = 0
            if scaleMass > 0 :
                scaleMass = scaleMass
            else :
                scaleMass = 1
            
            massPos = []
            massValue = []
            for mass in openSeesNodalMass  :
                index  = mass[0]
                massPos.append(pointWrapperDict.get( index  , "never"))
                massValue.append(mass[1][0]/scaleMass)
            
            Mass = th.list_to_tree( [ massPos , massValue ] )
            
            #######
            #######Support
            #######
            
            supportBrep = []
            
            for support in openSeesSupport :
                index = support[0]
                pos = pointWrapperDict.get( index  , "never")
                center_point = rg.Point3d( pos )
                
                if support[1] == 1 and support[2] == 0 and support[3] == 1 and support[4] == 1 and support[5] == 1 and support[6] == 1 : # carrello lungo y
                    supp = rg.Brep()
                    plane = rg.Plane.WorldYZ
                    radius = 0.15
                    length = radius*3.50
                    vector = rg.Vector3d( -length/2, 0 , -2.5*radius ) 
                    vectorTrasl = rg.Point3d.Add( center_point, vector )
                    trasl = rg.Transform.Translation( vectorTrasl.X, vectorTrasl.Y, vectorTrasl.Z ) 
                    plane.Transform( trasl )
                    circle = rg.Circle(plane, radius/2)
                    brepCylinder = rg.Brep.CreateFromCylinder( rg.Cylinder(circle, length), True, True )
                    cylinder1 = rg.Brep.DuplicateBrep(brepCylinder)
                    traslc1 = rg.Transform.Translation( 0, -length/4, 0 )
                    cylinder1.Transform( traslc1 )
                    cylinder2 = rg.Brep.DuplicateBrep(brepCylinder)
                    supp.Append( cylinder1 )
                    traslc2 = rg.Transform.Translation( 0, length/4, 0 )
                    cylinder2.Transform( traslc2 )
                    supp.Append( cylinder2 )
                    plane2 = rg.Plane.WorldXY
                    vector2 = rg.Vector3d( 0, 0 , 0 ) 
                    vectorTrasl2 = rg.Point3d.Add( center_point, vector2 )
                    trasl2 = rg.Transform.Translation( vectorTrasl2.X, vectorTrasl2.Y, vectorTrasl2.Z ) 
                    plane2.Transform( trasl2 )
                    supp.Append( AddForm2Center(plane2, length, radius*2) )
                    supportBrep.append( supp )
                if support[1] == 0 and support[2] == 1 and support[3] == 1 and support[4] == 1 and support[5] == 1 and support[6] == 1 : # carrello lungo x
                    supp = rg.Brep()
                    plane = rg.Plane.WorldZX
                    radius = 0.15
                    length = radius*3.50
                    vector = rg.Vector3d( 0, -length/2 , -2.5*radius ) 
                    vectorTrasl = rg.Point3d.Add( center_point, vector )
                    trasl = rg.Transform.Translation( vectorTrasl.X, vectorTrasl.Y, vectorTrasl.Z ) 
                    plane.Transform( trasl )
                    circle = rg.Circle(plane, radius/2)
                    brepCylinder = rg.Brep.CreateFromCylinder( rg.Cylinder(circle, length), True, True ) 
                    cylinder1 = rg.Brep.DuplicateBrep(brepCylinder)
                    traslc1 = rg.Transform.Translation( -length/4, 0, 0 )
                    cylinder1.Transform( traslc1 )
                    cylinder2 = rg.Brep.DuplicateBrep(brepCylinder)
                    supp.Append( cylinder1 )
                    traslc2 = rg.Transform.Translation( length/4, 0, 0 )
                    cylinder2.Transform( traslc2 )
                    supp.Append( cylinder2 )
                    plane2 = rg.Plane.WorldXY
                    vector2 = rg.Vector3d( 0, 0 , 0 )
                    vectorTrasl2 = rg.Point3d.Add( center_point, vector2 )
                    trasl2 = rg.Transform.Translation( vectorTrasl2.X, vectorTrasl2.Y, vectorTrasl2.Z ) 
                    plane2.Transform( trasl2 )
                    supp.Append( AddForm3Center(plane2, length, radius*2) )
                    supportBrep.append( supp )
                if support[1] == 1 and support[2] == 1 and support[3] == 1 and support[4] == 0 and support[5] == 1  : # cerniera lungo x
                    supp = rg.Brep()
                    plane = rg.Plane.WorldYZ
                    radius = 0.15
                    length = radius*3.50
                    vector = rg.Vector3d( -length/2, 0 , -radius )
                    vectorTrasl = rg.Point3d.Add( center_point, vector )
                    trasl = rg.Transform.Translation( vectorTrasl.X, vectorTrasl.Y, vectorTrasl.Z ) 
                    plane.Transform( trasl )
                    circle = rg.Circle(plane, radius)
                    supp.Append( rg.Brep.CreateFromCylinder( rg.Cylinder(circle, length), True, True ) )
                    plane2 = rg.Plane.WorldXY
                    vector2 = rg.Vector3d( 0, 0 , -1.70*radius )
                    vectorTrasl2 = rg.Point3d.Add( center_point, vector2 )
                    trasl2 = rg.Transform.Translation( vectorTrasl2.X, vectorTrasl2.Y, vectorTrasl2.Z ) 
                    plane2.Transform( trasl2 )
                    supp.Append( AddForm2Center(plane2, length, radius*2) )
                    supportBrep.append( supp )
                if support[1] == 1 and support[2] == 1 and support[3] == 1 and support[4] == 1 and support[5] == 0  : # cerniera lungo y
                    supp = rg.Brep()
                    plane = rg.Plane.WorldZX
                    radius = 0.15
                    length = radius*3.50
                    vector = rg.Vector3d( 0, -length/2 , -radius ) 
                    vectorTrasl = rg.Point3d.Add( center_point, vector )
                    trasl = rg.Transform.Translation( vectorTrasl.X, vectorTrasl.Y, vectorTrasl.Z ) 
                    plane.Transform( trasl )
                    circle = rg.Circle(plane, radius)
                    supp.Append( rg.Brep.CreateFromCylinder( rg.Cylinder(circle, length), True, True ) )
                    plane2 = rg.Plane.WorldXY
                    vector2 = rg.Vector3d( 0, 0 , -1.70*radius )
                    vectorTrasl2 = rg.Point3d.Add( center_point, vector2 )
                    trasl2 = rg.Transform.Translation( vectorTrasl2.X, vectorTrasl2.Y, vectorTrasl2.Z ) 
                    plane2.Transform( trasl2 )
                    supp.Append( AddForm3Center(plane2, length, radius*2) )
                    supportBrep.append( supp )
                if support[1] == 1 and support[2] == 1 and support[3] == 1 and support[4] == 0 and support[5] == 0   : # cerniera sferica
                    radius = 0.15
                    length = radius*3.50
                    vector = rg.Vector3d( 0, 0 , -radius ) 
                    center =  rg.Point3d.Add( center_point, vector )
                    supp = rg.Brep()
                    # sfera
                    supp.Append( rg.Brep.CreateFromSphere(rg.Sphere( center, radius)))
                    plane = rg.Plane.WorldXY
                    vectorTrasl = rg.Point3d.Add( center_point, 1.70*vector )
                    trasl = rg.Transform.Translation( vectorTrasl.X, vectorTrasl.Y, vectorTrasl.Z  )
                    plane.Transform( trasl )
                    # tronco di piramide
                    supp.Append( AddForm1Center(plane, length, radius*2) )
                    supportBrep.append( supp )
                if support[1] == 1 and support[2] == 1 and support[3] == 1 and support[4] == 1 and support[5] == 1  and support[6] == 1 : # incastro
                    plane = rg.Plane.WorldXY
                    length = 0.5
                    h = length/3
                    vector = rg.Vector3d( 0, 0 , 0 )
                    vectorTrasl = rg.Point3d.Add( center_point, vector )
                    trasl = rg.Transform.Translation( vectorTrasl.X, vectorTrasl.Y, vectorTrasl.Z  )
                    plane2 = rg.Plane.Clone( plane )
                    plane2.Transform( trasl )
                    supp = AddBoxFromCenter(plane2, length, h)[0]
                    supportBrep.append( supp[0] )

            if Model == True:
                self.line = line
                self.colorLine = colorLine
            else:
                self.line = []
                self.colorLine = []

            if Load == True:
                self.ancorPoint = ancorPoint
                self.forceDisplay = forceDisplay
            else:
                self.ancorPoint = []
                self.forceDisplay = []

            if NodeTag == True:
                self.posTag = posTag
                self.nodeTag = nodeTag
            else:
                self.posTag = []
                self.nodeTag = []

            if ElementTag == True:
                self.posEleTag = posEleTag
                self.eleTag = eleTag
            else:
                self.posEleTag = []
                self.eleTag = []

            if Support == True:
                self.supportBrep = supportBrep
                self.material = rc.Display.DisplayMaterial(System.Drawing.Color.Cyan, 0.0)
            else:
                self.supportBrep = []
                self.material = []
                
            
            if Model == True:
                return AlpacaModel, ModelView
            else:
                return AlpacaModel, ModelViewExtruded
            #return AlpacaModel, ModelView
            
        checkData = True
        
        if not AlpacaModel:
            checkData = False
            msg = "input 'AlpacaModel' failed to collect data"
            ghenv.Component.AddRuntimeMessage(gh.Kernel.GH_RuntimeMessageLevel.Warning, msg)
        
        if checkData != False:
            AlpacaModel, Model = VisualiseModel(AlpacaModel, Model, Support, Mass, LocalAxis, Load, NodeTag, ElementTag)
            return AlpacaModel, Model


    def DrawViewportWires(self,arg):
        
        for crv, color in zip(self.line, self.colorLine):
            arg.Display.DrawCurve(crv, color, 4)
        
        for ancor, force in zip(self.ancorPoint, self.forceDisplay):
            arg.Display.DrawArrow( Rhino.Geometry.Line(ancor, force) ,  System.Drawing.Color.LightBlue)
        
        for pos, tag in zip(self.posTag, self.nodeTag):
            arg.Display.Draw2dText(str(tag), System.Drawing.Color.Blue, pos, True, 20)
        
        for pos, tag in zip(self.posEleTag, self.eleTag):
            arg.Display.Draw2dText(str(tag), System.Drawing.Color.Red, pos, True, 20)
        
        for midPoint, axis1, axis2, axis3 in zip( self.midPoint, self.v1Display, self.v2Display, self.v3Display):
            arg.Display.DrawLine( midPoint, midPoint + axis1, System.Drawing.Color.Red, 3 )
            arg.Display.DrawLine( midPoint, midPoint + axis2, System.Drawing.Color.Green, 3 )
            arg.Display.DrawLine( midPoint, midPoint + axis3, System.Drawing.Color.Blue, 3 )
            
        for brep in self.supportBrep:
            arg.Display.DrawBrepShaded(brep,self.material)
# ---------- end ghpython_script_35 ----------
geometry_4 = Geometry(ghpython_script_35.Model)

panel_29 = Panel(analyze_2.MinDisplacement)  # disabled
panel_30 = Panel(analyze_2.MaxDisplacement)  # disabled
panel_31 = Panel(analyze_2.AlpacaGroundmotionOutput)  # disabled
ggkarambatosap2000 = GgKarambaToSAP2000(Enabled=boolean_toggle, Model=analyze_karamba3d.CalculatedModel, Independent=True)  # disabled
beam_forces_karamba3d = BeamForcesKaramba3D(
    AnalyzedModel=analyze_karamba3d.CalculatedModel,
    LCase=-1,
    MaximumDistanceBetweenResults_m=-1,
    NumberOfResultsPerBeamElement=2)  # -> AnalyzedModel, simplify(NormalForce_kN), simplify(ShearForceVz_kN), simplify(ShearForceVy_kN), simplify(BendingMomentMt_kNm), simplify(BendingMomentMy_kNm), simplify(BendingMomentMz_kNm)
data_19 = Data(ghpython_script_33.AlpacaModel)  # disabled
tree_statistics = TreeStatistics(Tree=beam_forces_karamba3d.NormalForce_kN)  # -> Paths, Length, Count
data_20 = Data(ghpython_script_33.AlpacaModel)

# ----
# Modal Analyses
file_path_28 = FilePath("C:\GitHub\Alpaca4d\PythonScript\Analyses\DynamicAnalysis\initializeModalAnalyses.py")
read_file_28 = ReadFile(File=file_path_28, PerLineParse=False)
analyze_5 = GhPythonScript(Code=read_file_28, AlpacaModel=data_20, NumVibrationModes="3")  # -> Out, AlpacaModalOutput, Frequency, Period

# ----
# LinearDinamicForce
panel_32 = Panel("2.0")  # disabled
panel_33 = Panel("5.88")  # disabled
file_path_29 = FilePath("C:\GitHub\Alpaca4d\PythonScript\Analyses\LinearDynamicAnalysis\initializeLinearDynamicAnalyses.py")  # disabled
read_file_29 = ReadFile(File=file_path_29, PerLineParse=False)  # disabled
analyze_6 = GhPythonScript(
    Code=read_file_29,
    AlpacaModel=data_19,
    NumVibrationModes="3",
    Ag=panel_20,
    F0=panel_18,
    S=panel_16,
    Tb=panel_17,
    Tc=panel_19,
    Td=panel_32,
    Q=panel_33)  # -> Frequency, Period, MassPart, Spectrum, PossNodeForce, ForceX, ForceY; disabled

ghpython_script_36 = GhPythonScript(
    AlpacaGroundmotionOutput=analyze_2.AlpacaGroundmotionOutput,
    speed=number_slider_16,
    Animate=boolean_toggle_2,
    Reset=button,
    scale=number_slider_15,
    direction=value_list_2,
    modelExtrude=boolean_toggle_3)  # -> modelDisp, PointPos, PointDisp, domainValues, trans; inputs AlpacaGroundmotionOutput: list, speed: Int32, direction: Int32, colorList: list of Color; disabled
# ---------- ghpython_script_36: Python ----------
"""Visualize the Modal Shapes
    Inputs:
        AlpacaGroundmotionOutput: Ground Motion Analyses Output.
        speed: Bigger value will make the visualisation faster.
        Animate: True to see the deformed shape during the time.
        Reset: 
        scale: Amplitude value for deformation. Default is 10.
        direction:
        ExtrudedModel: True - Visualise Extruded Model.
        colorList:
    Output:
        ModelDisp:
        PointPos: Point representing the model.
        PointDisp: Displacement vector of each node. The value change along the visualisation.
        domainValues: max and min displacement of the structure.
        trans: list of Displacement vector during the time.
"""


from ghpythonlib.componentbase import executingcomponent as component
import Grasshopper, GhPython
import System
import Rhino
import rhinoscriptsyntax as rs

class MyComponent(component):
    
    def RunScript(self, AlpacaGroundmotionOutput, speed, Animate, Reset, scale, direction, modelExtrude, colorList ):

        import Rhino as rc
        import Rhino.Geometry as rg
        import math as mt
        import ghpythonlib.treehelpers as th # per data tree
        import Grasshopper as gh
        import sys
        import rhinoscriptsyntax as rs
        import Rhino.Display as rd
        from scriptcontext import sticky as st
        import System.Drawing.Color
        import scriptcontext as sc
        import time
        
        #---------------------------#
        def alphat( E, G, I, At ):
            return (E*I)/(G*At)
        
        ## Spostamenti e rotazioni ##
        def spostu( x, L, uI, uJ ):
            return -(-L*uI + uI*x - uJ*x)/L
            
        def spostv( x, L, vI, vJ, thetaI, thetaJ, alphay ):
            return (L**3*thetaI*x + L**3*vI - 2*L**2*thetaI*x**2 - L**2*thetaJ*x**2 + 6*L*alphay*thetaI*x - 6*L*alphay*thetaJ*x + 12*L*alphay*vI + L*thetaI*x**3 + L*thetaJ*x**3 - 3*L*vI*x**2 + 3*L*vJ*x**2 - 6*alphay*thetaI*x**2 + 6*alphay*thetaJ*x**2 - 12*alphay*vI*x + 12*alphay*vJ*x + 2*vI*x**3 - 2*vJ*x**3)/(L*(L**2 + 12*alphay))
            
        def spostw( x, L, wI, wJ, psiI, psiJ, alphaz ):
            return -(L**3*psiI*x - L**3*wI - 2*L**2*psiI*x**2 - L**2*psiJ*x**2 - 6*L*alphaz*psiI*x + 6*L*alphaz*psiJ*x + 12*L*alphaz*wI + L*psiI*x**3 + L*psiJ*x**3 + 3*L*wI*x**2 - 3*L*wJ*x**2 + 6*alphaz*psiI*x**2 - 6*alphaz*psiJ*x**2 - 12*alphaz*wI*x + 12*alphaz*wJ*x - 2*wI*x**3 + 2*wJ*x**3)/(L*(L**2 - 12*alphaz))
            
        def thetaz(x, L, vI, vJ, thetaI, thetaJ, alphay): 
            return (L**3*thetaI - 4*L**2*thetaI*x - 2*L**2*thetaJ*x + 12*L*alphay*thetaI + 3*L*thetaI*x**2 + 3*L*thetaJ*x**2 - 6*L*vI*x + 6*L*vJ*x - 12*alphay*thetaI*x + 12*alphay*thetaJ*x + 6*vI*x**2 - 6*vJ*x**2)/(L*(L**2 + 12*alphay))
            
        def phix(x, L, phiI, phiJ):
            return -(-L*phiI + phiI*x - phiJ*x)/L
        
        def psiy(x, L, wI, wJ, psiI, psiJ, alphaz): 
            return (L**3*psiI - 4*L**2*psiI*x - 2*L**2*psiJ*x - 12*L*alphaz*psiI + 3*L*psiI*x**2 + 3*L*psiJ*x**2 + 6*L*wI*x - 6*L*wJ*x + 12*alphaz*psiI*x - 12*alphaz*psiJ*x - 6*wI*x**2 + 6*wJ*x**2)/(L*(L**2 - 12*alphaz))
            
        def gammay( L, vI, vJ, thetaI, thetaJ, alphay): 
        
            return (L*thetaI + L*thetaJ + 2*vI - 2*vJ)/(L*(L**2 + 12*alphay))
            
        def gammaz( L, wI, wJ, psiI, psiJ, alphaz):
        
            return -(L*psiI + L*psiJ - 2*wI + 2*wJ)/(L*(L**2 - 12*alphaz))
        
        ##------------------------------------------------------------------------- --##
        
        def scaleAutomatic( Num , Den ):
            if Den < 0.1 :
                return Num
            else :
                return Num*1/Den
        
        def linspace(a, b, n=100):
            if n < 2:
                return b
            diff = (float(b) - a)/(n - 1)
            return [diff * i + a  for i in range(n)]
        
        ## Funzione rettangolo ##
        def AddRectangleFromCenter(plane, width, height):
            a = plane.PointAt(-width * 0.5, -height * 0.5 )
            b = plane.PointAt(-width * 0.5,  height * 0.5 )
            c = plane.PointAt( width * 0.5,  height * 0.5 )
            d = plane.PointAt( width * 0.5,  -height * 0.5 )
            #rectangle = rg.PolylineCurve( [a, b, c, d, a] )
            rectangle  = [a, b, c, d] 
            return rectangle
        
        ## Funzione cerchio ##
        def AddCircleFromCenter( plane, radius):
            t = linspace( 0 , 1.80*mt.pi, 15 )
            a = []
            for ti in t:
                x = radius*mt.cos(ti)
                y = radius*mt.sin(ti)
                a.append( plane.PointAt( x, y ) )
            #circle = rg.PolylineCurve( a )
            circle  = a 
            return circle
        
        def AddIFromCenter(plane, Bsup, tsup, Binf, tinf, H, ta, yg):
            #-------------------1---------2 #
            p1 = plane.PointAt( -(yg - tinf), ta/2 )
            p2 = plane.PointAt( -(yg - tinf), Binf/2 )
            p3 = plane.PointAt( -yg, Binf/2 )
            p4 = plane.PointAt( -yg, -Binf/2 )
            p5 = plane.PointAt( -(yg - tinf), -Binf/2 ) 
            p6 = plane.PointAt( -(yg - tinf), -ta/2 )
            p7 = plane.PointAt( (H - yg - tsup), -ta/2)
            p8 = plane.PointAt( (H - yg - tsup), -Bsup/2 )
            p9 = plane.PointAt( (H - yg ), -Bsup/2 )
            p10 = plane.PointAt( (H - yg ), Bsup/2 )
            p11 = plane.PointAt( (H - yg - tsup), Bsup/2 )
            p12 = plane.PointAt( (H - yg - tsup), ta/2 )
        
            wirframe  = [ p1, p2, p3, p4, p5, p6, p7, p8, p9, p10, p11, p12 ] 
            return wirframe
        
        def defShellQuad( ele, node, nodeDisp, scaleDef ):
            
            eleTag = ele[0]
            eleNodeTag = ele[1]
            color = ele[2][2]
            thick = ele[2][1]
            #print( eleNodeTag )
            #print( eleNodeTag )
            index1 = eleNodeTag[0] 
            index2 = eleNodeTag[1] 
            index3 = eleNodeTag[2] 
            index4 = eleNodeTag[3] 
            
            trasl1 = nodeDisp.get( index1 , "never")[0]
            rotate1 = nodeDisp.get( index1 , "never")[1]
            
            trasl2 = nodeDisp.get( index2 , "never")[0]
            rotate2 = nodeDisp.get( index2 , "never")[1]
            
            trasl3 = nodeDisp.get( index3 , "never")[0]
            rotate3 = nodeDisp.get( index3 , "never")[1]
            
            trasl4 = nodeDisp.get( index4 , "never")[0]
            rotate4 = nodeDisp.get( index4 , "never")[1]
            
            ## CREO IL MODELLO DEFORMATO  ##
            
            pointDef1 = rg.Point3d.Clone( node.get( index1 , "never") )
            pointDef2 = rg.Point3d.Clone( node.get( index2 , "never") )
            pointDef3 = rg.Point3d.Clone( node.get( index3 , "never") )
            pointDef4 = rg.Point3d.Clone( node.get( index4 , "never") )
            #print( index1 - 1)
            #print( nodeDisp )
            vectortrasl1 = rg.Transform.Translation( rg.Vector3d(trasl1.X, trasl1.Y, trasl1.Z)*scaleDef )
            pointDef1.Transform( vectortrasl1 )
            vectortrasl2 = rg.Transform.Translation( rg.Vector3d(trasl2.X, trasl2.Y, trasl2.Z)*scaleDef )
            pointDef2.Transform( vectortrasl2 )
            vectortrasl3 = rg.Transform.Translation( rg.Vector3d(trasl3.X, trasl3.Y, trasl3.Z)*scaleDef )
            pointDef3.Transform( vectortrasl3 )
            vectortrasl4 = rg.Transform.Translation( rg.Vector3d(trasl4.X, trasl4.Y, trasl4.Z)*scaleDef )
            pointDef4.Transform( vectortrasl4 )
            shellDefModel = rg.Mesh()
            shellDefModel.Vertices.Add( pointDef1 ) #0
            shellDefModel.Vertices.Add( pointDef2 ) #1
            shellDefModel.Vertices.Add( pointDef3 ) #2
            shellDefModel.Vertices.Add( pointDef4 ) #3
            
            
            shellDefModel.Faces.AddFace(0, 1, 2, 3)
            colour = rs.CreateColor( color[0], color[1], color[2] )
            shellDefModel.VertexColors.CreateMonotoneMesh( colour )
        
            vt = shellDefModel.Vertices
            shellDefModel.FaceNormals.ComputeFaceNormals()
            fid,MPt = shellDefModel.ClosestPoint(vt[0],0.01)
            normalFace = shellDefModel.FaceNormals[fid]
            vectormoltiplicate = rg.Vector3d.Multiply( -normalFace, thick/2 )
            trasl = rg.Transform.Translation( vectormoltiplicate )
            moveShell = rg.Mesh.DuplicateMesh(shellDefModel)
            moveShell.Transform( trasl )
            extrudeShell = rg.Mesh.Offset( moveShell, thick, True, normalFace)
            return  [shellDefModel,[trasl1, trasl2, trasl3, trasl4], [rotate1, rotate2, rotate3, rotate4], extrudeShell ]
        
        def defShellTriangle( ele, node, nodeDisp, scaleDef ):
            
            eleTag = ele[0]
            eleNodeTag = ele[1]
            color = ele[2][1]
            index1 = eleNodeTag[0] - 1
            index2 = eleNodeTag[1] - 1
            index3 = eleNodeTag[2] - 1
            
            trasl1 = nodeDisp.get( index1 , "never")[0]
            rotate1 = nodeDisp.get( index1  , "never")[1]
            
            trasl2 = nodeDisp.get( index2 , "never")[0]
            rotate2 = nodeDisp.get( index2 , "never")[1]
            
            trasl3 = nodeDisp.get( index3 , "never")[0]
            rotate3 = nodeDisp.get( index3 , "never")[1]
            
            ## CREO IL MODELLO DEFORMATO  ##
            pointDef1 = rg.Point3d.Clone( node.get( index1 , "never") )
            pointDef2 = rg.Point3d.Clone( node.get( index2 , "never") )
            pointDef3 = rg.Point3d.Clone( node.get( index3 , "never") )
            vectortrasl1 = rg.Transform.Translation( rg.Vector3d(trasl1.X, trasl1.Y, trasl1.Z)*scaleDef )
            pointDef1.Transform( vectortrasl1 )
            vectortrasl2 = rg.Transform.Translation( rg.Vector3d(trasl2.X, trasl2.Y, trasl2.Z)*scaleDef )
            pointDef2.Transform( vectortrasl2 )
            vectortrasl3 = rg.Transform.Translation( rg.Vector3d(trasl3.X, trasl3.Y, trasl3.Z)*scaleDef )
            pointDef3.Transform( vectortrasl3 )
            shellDefModel = rg.Mesh()
            shellDefModel.Vertices.Add( pointDef1 ) #0
            shellDefModel.Vertices.Add( pointDef2 ) #1
            shellDefModel.Vertices.Add( pointDef3 ) #2
            
            shellDefModel.Faces.AddFace(0, 1, 2)
            colour = rs.CreateColor( color[0], color[1], color[2] )
            vt = shellDefModel.Vertices
            shellDefModel.FaceNormals.ComputeFaceNormals()
            fid,MPt = shellDefModel.ClosestPoint(vt[0],0.01)
            normalFace = shellDefModel.FaceNormals[fid]
            vectormoltiplicate = rg.Vector3d.Multiply( -normalFace, thick/2 )
            trasl = rg.Transform.Translation( vectormoltiplicate )
            moveShell = rg.Mesh.DuplicateMesh(shellDefModel)
            moveShell.Transform( trasl )
            extrudeShell = rg.Mesh.Offset( moveShell, thick, True, normalFace)
            return  [shellDefModel,[trasl1, trasl2, trasl3], [rotate1, rotate2, rotate3], extrudeShell ]
        
        def defSolid( ele, node, nodeDisp, scaleDef ):
            
            eleTag = ele[0]
            eleNodeTag = ele[1]
            color = ele[2][1]
            thick = ele[2][1]
            #print( eleNodeTag )
            index1 = eleNodeTag[0] - 1
            index2 = eleNodeTag[1] - 1
            index3 = eleNodeTag[2] - 1
            index4 = eleNodeTag[3] - 1
            index5 = eleNodeTag[4] - 1
            index6 = eleNodeTag[5] - 1
            index7 = eleNodeTag[6] - 1
            index8 = eleNodeTag[7] - 1
            
            trasl1 = nodeDisp.get( index1 , "never")
            trasl2 = nodeDisp.get( index2 , "never")
            trasl3 = nodeDisp.get( index3 , "never")
            trasl4 = nodeDisp.get( index4 , "never")
            trasl5 = nodeDisp.get( index5 , "never")
            trasl6 = nodeDisp.get( index6 , "never")
            trasl7 = nodeDisp.get( index7 , "never")
            trasl8 = nodeDisp.get( index8 , "never")
            
            ## CREO IL MODELLO DEFORMATO  ##
            pointDef1 = rg.Point3d.Clone( node.get( index1 , "never") )
            pointDef2 = rg.Point3d.Clone( node.get( index2 , "never") )
            pointDef3 = rg.Point3d.Clone( node.get( index3 , "never") )
            pointDef4 = rg.Point3d.Clone( node.get( index4 , "never") )
            pointDef5 = rg.Point3d.Clone( node.get( index5 , "never") )
            pointDef6 = rg.Point3d.Clone( node.get( index6 , "never") )
            pointDef7 = rg.Point3d.Clone( node.get( index7 , "never") )
            pointDef8 = rg.Point3d.Clone( node.get( index8 , "never") )
            vectortrasl1 = rg.Transform.Translation( rg.Vector3d(trasl1.X, trasl1.Y, trasl1.Z)*scaleDef )
            pointDef1.Transform( vectortrasl1 )
            vectortrasl2 = rg.Transform.Translation( rg.Vector3d(trasl2.X, trasl2.Y, trasl2.Z)*scaleDef )
            pointDef2.Transform( vectortrasl2 )
            vectortrasl3 = rg.Transform.Translation( rg.Vector3d(trasl3.X, trasl3.Y, trasl3.Z)*scaleDef )
            pointDef3.Transform( vectortrasl3 )
            vectortrasl4 = rg.Transform.Translation( rg.Vector3d(trasl4.X, trasl4.Y, trasl4.Z)*scaleDef )
            pointDef4.Transform( vectortrasl4 )
            vectortrasl5 = rg.Transform.Translation( rg.Vector3d(trasl5.X, trasl5.Y, trasl5.Z)*scaleDef )
            pointDef5.Transform( vectortrasl1 )
            vectortrasl6 = rg.Transform.Translation( rg.Vector3d(trasl6.X, trasl6.Y, trasl6.Z)*scaleDef )
            pointDef6.Transform( vectortrasl2 )
            vectortrasl7 = rg.Transform.Translation( rg.Vector3d(trasl7.X, trasl7.Y, trasl7.Z)*scaleDef )
            pointDef7.Transform( vectortrasl3 )
            vectortrasl8 = rg.Transform.Translation( rg.Vector3d(trasl8.X, trasl8.Y, trasl8.Z)*scaleDef )
            pointDef8.Transform( vectortrasl4 )
            
            shellDefModel = rg.Mesh()
            shellDefModel.Vertices.Add( pointDef1 ) #0
            shellDefModel.Vertices.Add( pointDef2 ) #1
            shellDefModel.Vertices.Add( pointDef3 ) #2
            shellDefModel.Vertices.Add( pointDef4 ) #3
            shellDefModel.Vertices.Add( pointDef5 ) #4
            shellDefModel.Vertices.Add( pointDef6 ) #5
            shellDefModel.Vertices.Add( pointDef7 ) #6
            shellDefModel.Vertices.Add( pointDef8 ) #7
        
            shellDefModel.Faces.AddFace(0, 1, 2, 3)
            shellDefModel.Faces.AddFace(4, 5, 6, 7)
            shellDefModel.Faces.AddFace(0, 1, 5, 4)
            shellDefModel.Faces.AddFace(1, 2, 6, 5)
            shellDefModel.Faces.AddFace(2, 3, 7, 6)
            shellDefModel.Faces.AddFace(3, 0, 4, 7)
            
            colour = rs.CreateColor( color[0], color[1], color[2] )
            shellDefModel.VertexColors.CreateMonotoneMesh( colour )
            return  [shellDefModel,[trasl1, trasl2, trasl3,trasl4, trasl5, trasl6, trasl7, trasl8 ]]
        
        def defTetraSolid( ele, node, nodeDisp, scaleDef ):
            
            eleTag = ele[0]
            eleNodeTag = ele[1]
            color = ele[2][1]
            #print( eleNodeTag )
            index1 = eleNodeTag[0] - 1
            index2 = eleNodeTag[1] - 1
            index3 = eleNodeTag[2] - 1
            index4 = eleNodeTag[3] - 1
            
            trasl1 = nodeDisp.get( index1 , "never")
            trasl2 = nodeDisp.get( index2 , "never")
            trasl3 = nodeDisp.get( index3 , "never")
            trasl4 = nodeDisp.get( index4 , "never")
            
            ## CREO IL MODELLO DEFORMATO  ##
            pointDef1 = rg.Point3d.Clone( node.get( index1 , "never") )
            pointDef2 = rg.Point3d.Clone( node.get( index2 , "never") )
            pointDef3 = rg.Point3d.Clone( node.get( index3 , "never") )
            pointDef4 = rg.Point3d.Clone( node.get( index4 , "never") )
            
            vectortrasl1 = rg.Transform.Translation( rg.Vector3d(trasl1.X, trasl1.Y, trasl1.Z)*scaleDef )
            pointDef1.Transform( vectortrasl1 )
            vectortrasl2 = rg.Transform.Translation( rg.Vector3d(trasl2.X, trasl2.Y, trasl2.Z)*scaleDef )
            pointDef2.Transform( vectortrasl2 )
            vectortrasl3 = rg.Transform.Translation( rg.Vector3d(trasl3.X, trasl3.Y, trasl3.Z)*scaleDef )
            pointDef3.Transform( vectortrasl3 )
            vectortrasl4 = rg.Transform.Translation( rg.Vector3d(trasl4.X, trasl4.Y, trasl4.Z)*scaleDef )
            pointDef4.Transform( vectortrasl4 )
        
            shellDefModel = rg.Mesh()
            shellDefModel.Vertices.Add( pointDef1 ) #0
            shellDefModel.Vertices.Add( pointDef2 ) #1
            shellDefModel.Vertices.Add( pointDef3 ) #2
            shellDefModel.Vertices.Add( pointDef4 ) #3
            
            
            shellDefModel.Faces.AddFace( 0, 1, 2 )
            shellDefModel.Faces.AddFace( 0, 1, 3 )
            shellDefModel.Faces.AddFace( 1, 2, 3 )
            shellDefModel.Faces.AddFace( 0, 2, 3 )
            colour = rs.CreateColor( color[0], color[1], color[2] )
            shellDefModel.VertexColors.CreateMonotoneMesh( colour )
            
            return  [shellDefModel,[trasl1, trasl2, trasl3, trasl4]]
        ## node e nodeDisp son dictionary ##
        def defValueTimoshenkoBeam( ele, node, nodeDisp, scaleDef ):
            #---------------- WORLD PLANE ----------------------#
            WorldPlane = rg.Plane.WorldXY
            #--------- Propriety TimoshenkoBeam  ----------------#
            TagEle = ele[0]
            propSection = ele[2]
            indexStart = ele[1][0]
            indexEnd = ele[1][1]
            #print( indexStart, indexEnd )
            color = propSection[12]
            E = propSection[1]
            G = propSection[2]
            A = propSection[3]
            Avz = propSection[4]
            Avy = propSection[5]
            Jxx = propSection[6]
            Iy = propSection[7]
            Iz = propSection[8]
            #---- traslation and rotation index start & end ------- #
            traslStart = nodeDisp.get( indexStart , "never")[0]
            rotateStart = nodeDisp.get( indexStart , "never")[1]
            traslEnd = nodeDisp.get( indexEnd , "never")[0]
            rotateEnd = nodeDisp.get( indexEnd , "never")[1]
            ##-------------------------------------------- ------------##
            pointStart = node.get( indexStart  , "never")
            pointEnd = node.get( indexEnd  , "never")
            line = rg.LineCurve( pointStart, pointEnd )
            #-------------------------versor ---------------------------#
            axis1 =  rg.Vector3d( propSection[9][0][0], propSection[9][0][1], propSection[9][0][2]  )
            axis2 =  rg.Vector3d( propSection[9][1][0], propSection[9][1][1], propSection[9][1][2]  )
            axis3 =  rg.Vector3d( propSection[9][2][0], propSection[9][2][1], propSection[9][2][2]  )
            versor = [ axis1, axis2, axis3 ] 
            #---------- WORLD PLANE on point start of line ---------------#
            traslPlane = rg.Transform.Translation( pointStart.X, pointStart.Y, pointStart.Z )
            WorldPlane.Transform( traslPlane )
            #-------------------------------------------------------------#
            planeStart = rg.Plane(pointStart, axis1, axis2 )
            #planeStart = rg.Plane(pointStart, axis3 )
            localPlane = planeStart
            xform = rg.Transform.ChangeBasis( WorldPlane, localPlane )
            localTraslStart = rg.Point3d( traslStart )
            vectorTrasform = rg.Transform.TransformList( xform, [ traslStart, rotateStart, traslEnd, rotateEnd ] )
            #print( vectorTrasform[0] )
            localTraslStart = vectorTrasform[0]
            uI1 = localTraslStart.X # spostamento in direzione dell'asse rosso 
            uI2 = localTraslStart.Y # spostamento in direzione dell'asse verde
            uI3 = localTraslStart.Z # spostamento linea d'asse
            localRotStart = vectorTrasform[1]
            rI1 = localRotStart.X # 
            rI2 = localRotStart.Y # 
            rI3 = localRotStart.Z # 
            localTraslEnd = vectorTrasform[2]
            uJ1 = localTraslEnd.X # spostamento in direzione dell'asse rosso 
            uJ2 = localTraslEnd.Y # spostamento in direzione dell'asse verde
            uJ3 = localTraslEnd.Z # spostamento linea d'asse
            localRotEnd = vectorTrasform[3]
            rJ1 = localRotEnd[0] #  
            rJ2 = localRotEnd[1]  # 
            rJ3 = localRotEnd[2]  # 
            ##------------------ displacement value -------------------------##
            Length = rg.Curve.GetLength( line )
            divideDistance = 0.5
            DivCurve = line.DivideByLength( divideDistance, True )
            if DivCurve == None:
                DivCurve = [ 0, Length]
                
            #s = linspace(0,Length, len(PointsDivLength))
            AlphaY = alphat( E, G, Iy, Avz )
            AlphaZ = alphat( E, G, Iz, Avy )
            
            globalTransVector = []
            globalRotVector = []
            defPoint = []
            defSection = []
            #----------------------- local to global-------------------------#
            xform2 = xform.TryGetInverse()
            #----------------------------------------------------------------#
            for index, x in enumerate(DivCurve):
                beamPoint = line.PointAt(DivCurve[index]) 
                ## SPOSTAMENTO IN DIREZIONE DELL' ASSE 3 ##
                u3 = spostu(x, Length, uI3, uJ3)
                u3Vector = u3*axis3
                ## SPOSTAMENTO IN DIREZIONE DELL' ASSE 1 ##
                v1 =  spostv(x, Length, uI1, uJ1, rI2, rJ2, AlphaY)
                v1Vector = v1*axis1 
                ## SPOSTAMENTO IN DIREZIONE DELL' ASSE 2 ##
                v2 =  spostw(x, Length, uI2, uJ2, rI1, rJ1, AlphaZ)
                v2Vector = v2*axis2 
                
                ## RISULTANTE SPOSTAMENTI ##
                transResult = v1Vector + v2Vector + u3Vector
                
                r2x =  thetaz(x, Length, uI1, uJ1, rI2, rJ2, AlphaY)
                r1x =  psiy(x, Length, uI2, uJ2, rI1, rJ1, AlphaZ)
                r3x = phix(x, Length, rI3, rJ3)
                
                rotResult = r1x*axis1 + r2x*axis2 + r3x*axis3
                
                trasl = rg.Transform.Translation( transResult*scaleDef )
                beamPoint.Transform( trasl )
                defPoint.append( beamPoint )
                
                sectionPlane = rg.Plane( beamPoint, axis1, axis2 )
                sectionPlane.Rotate( scaleDef*r1x, axis1, beamPoint )
                sectionPlane.Rotate( scaleDef*r2x, axis2, beamPoint )
                sectionPlane.Rotate( scaleDef*r3x, axis3, beamPoint )
                if dimSection[0] == 'rectangular' :
                    width, height = dimSection[1], dimSection[2]
                    section = AddRectangleFromCenter( sectionPlane, width, height )
                    defSection.append( section )
                elif dimSection[0] == 'circular' :
                    radius1  = dimSection[1]/2
                    radius2  = dimSection[1]/2 - dimSection[2]
                    section1 = AddCircleFromCenter( sectionPlane, radius1 )
                    if (radius1 - radius2 ) == 0 :
                        defSection.append( section1 )
                    else :
                        section2 = AddCircleFromCenter( sectionPlane, radius2 )
                        defSection.append( [ section1, section2 ] )
                elif dimSection[0] == 'doubleT' :
                    Bsup = dimSection[1]
                    tsup = dimSection[2]
                    Binf = dimSection[3]
                    tinf = dimSection[4]
                    H =  dimSection[5]
                    ta =  dimSection[6]
                    yg =  dimSection[7]
                    section = AddIFromCenter( sectionPlane, Bsup, tsup, Binf, tinf, H, ta, yg )
                    defSection.append( section )
                elif dimSection[0] == 'Generic' :
                    radius  = dimSection[1]
                    section = AddCircleFromCenter( sectionPlane, radius )
                    defSection.append( section )
            
                globalTrasl = rg.Point3d( transResult ) 
                globalTrasl.Transform(xform2[1]) 
                globalTrasl.Transform(xform)
                globalTransVector.append( globalTrasl )
        
           
            defpolyline = rg.PolylineCurve( defPoint )
        
            if dimSection[0] == 'circular' :
                radius1  = dimSection[1]/2
                radius2  = dimSection[1]/2 - dimSection[2]
                if (radius1 - radius2 ) == 0:
                    meshdef = meshLoft3( defSection,  color )
        
                else :
                    defSection1 = [row[0] for row in defSection ]
                    defSection2 = [row[1] for row in defSection ]
                    meshdef = meshLoft3( defSection1,  color )
                    meshdef.Append( meshLoft3( defSection2,  color ) )
                    #print( meshdef )
        
            else  :
                meshdef = meshLoft3( defSection,  color )
            return  [  defpolyline, meshdef ,  globalTransVector, globalRotVector ] 
        
        ## node e nodeDisp son dictionary ##
        def defTruss( ele, node, nodeDisp, scale ):
            WorldPlane = rg.Plane.WorldXY
            TagEle = ele[0]
            propSection = ele[2]
            color = propSection[12]
            indexStart = ele[1][0]
            indexEnd = ele[1][1]
            #print( indexStart, indexEnd )
            E = propSection[1]
            A = propSection[3]
            
            traslStart = nodeDisp.get( indexStart , "never")
            traslEnd = nodeDisp.get( indexEnd  , "never")
            if len( traslStart ) == 2:
                traslStart = nodeDisp.get( indexStart  , "never")[0]
                traslEnd = nodeDisp.get( indexEnd  , "never")[0]
            pointStart = node.get( indexStart  , "never")
            pointEnd = node.get( indexEnd  , "never")
            #print( traslStart[1] )
            line = rg.LineCurve( pointStart,  pointEnd )
        
            axis1 =  rg.Vector3d( propSection[9][0][0], propSection[9][0][1], propSection[9][0][2]  )
            axis2 =  rg.Vector3d( propSection[9][1][0], propSection[9][1][1], propSection[9][1][2]  )
            axis3 =  rg.Vector3d( propSection[9][2][0], propSection[9][2][1], propSection[9][2][2]  )
            versor = [ axis1, axis2, axis3 ] 
            #---------- WORLD PLANE on point start of line ---------------#
            traslPlane = rg.Transform.Translation( pointStart.X, pointStart.Y, pointStart.Z )
            WorldPlane.Transform( traslPlane )
            #-------------------------------------------------------------#
            planeStart = rg.Plane(pointStart, axis1, axis2 )
            #planeStart = rg.Plane(pointStart, axis3 )
            localPlane = planeStart
            xform = rg.Transform.ChangeBasis( WorldPlane, localPlane )
            localTraslStart = rg.Point3d( traslStart )
            vectorTrasform = rg.Transform.TransformList( xform, [ traslStart , traslEnd ] )
            #print( vectorTrasform[0] )
            localTraslStart = vectorTrasform[0]
            uI1 = localTraslStart.X # spostamento in direzione dell'asse rosso 
            uI2 = localTraslStart.Y # spostamento in direzione dell'asse verde
            uI3 = localTraslStart.Z # spostamento linea d'asse
            localTraslEnd = vectorTrasform[1]
            uJ1 = localTraslEnd.X # spostamento in direzione dell'asse rosso 
            uJ2 = localTraslEnd.Y # spostamento in direzione dell'asse verde
            uJ3 = localTraslEnd.Z # spostamento linea d'asse
            ##-------------- displacement value -------------------------##
            Length = rg.Curve.GetLength( line )
            divideDistance = 0.5
            DivCurve = line.DivideByLength( divideDistance, True )
            if DivCurve == None:
                DivCurve = [ 0, Length]
            defPoint = []
            defSection = []
            globalTransVector = []
            #----------------------- local to global-------------------------#
            xform2 = xform.TryGetInverse()
            #----------------------------------------------------------------#
            for index, x in enumerate(DivCurve):
                beamPoint = line.PointAt(DivCurve[index]) 
                ## SPOSTAMENTO IN DIREZIONE DELL' ASSE 3 ##
                u3 = spostu(x, Length, uI3, uJ3)
                u3Vector = u3*axis3
                ## SPOSTAMENTO IN DIREZIONE DELL' ASSE 1 ##
                v1 =  x*( uJ1 - uI1 )/Length + uI1
                v1Vector = v1*axis1 
                ## SPOSTAMENTO IN DIREZIONE DELL' ASSE 2 ##
                v2 =  x*( uJ2 - uI2 )/Length + uI2
                v2Vector = v2*axis2 
                ## RISULTANTE SPOSTAMENTI ##
                transResult = v1Vector + v2Vector + u3Vector
                trasl = rg.Transform.Translation( transResult*scale )
                beamPoint.Transform( trasl )
                defPoint.append( beamPoint )
                
                sectionPlane = rg.Plane( beamPoint, axis1, axis2 )
                if dimSection[0] == 'rectangular' :
                    width, height = dimSection[1], dimSection[2]
                    section = AddRectangleFromCenter( sectionPlane, width, height )
                    defSection.append( section )
                elif dimSection[0] == 'circular' :
                    radius1  = dimSection[1]/2
                    radius2  = dimSection[1]/2 - dimSection[2]
                    section1 = AddCircleFromCenter( sectionPlane, radius1 )
                    if (radius1 - radius2 ) == 0 :
                        defSection.append( section1 )
                    else :
                        section2 = AddCircleFromCenter( sectionPlane, radius2 )
                        defSection.append( [ section1, section2 ] )
                elif dimSection[0] == 'doubleT' :
                    Bsup = dimSection[1]
                    tsup = dimSection[2]
                    Binf = dimSection[3]
                    tinf = dimSection[4]
                    H =  dimSection[5]
                    ta =  dimSection[6]
                    yg =  dimSection[7]
                    section = AddIFromCenter( sectionPlane, Bsup, tsup, Binf, tinf, H, ta, yg )
                    defSection.append( section )
                elif dimSection[0] == 'Generic' :
                    radius  = dimSection[1]
                    section = AddCircleFromCenter( sectionPlane, radius )
                    defSection.append( section )
            
                globalTrasl = rg.Point3d( transResult ) 
                globalTrasl.Transform(xform2[1]) 
                globalTrasl.Transform(xform)
                globalTransVector.append( globalTrasl )
        
           
            defpolyline = rg.PolylineCurve( defPoint )
        
            if dimSection[0] == 'circular' :
                radius1  = dimSection[1]/2
                radius2  = dimSection[1]/2 - dimSection[2]
                if (radius1 - radius2 ) == 0:
                    meshdef = meshLoft3( defSection,  color )
        
                else :
                    defSection1 = [row[0] for row in defSection ]
                    defSection2 = [row[1] for row in defSection ]
                    meshdef = meshLoft3( defSection1,  color )
                    meshdef.Append( meshLoft3( defSection2,  color ) )
                    #print( meshdef )
        
            else  :
                meshdef = meshLoft3( defSection,  color )
            return  [ defpolyline, meshdef, globalTransVector] 
        ## Mesh from close section eith gradient color ##
        
        def meshLoft3( point, color ):
            meshElement = rg.Mesh()
            meshEle = rg.Mesh()
            pointSection1 = point
            #print( point )
            for i in range(0,len(pointSection1)):
                for j in range(0, len(pointSection1[0])):
                    vertix = pointSection1[i][j]
                    #print( type(vertix) )
                    meshEle.Vertices.Add( vertix ) 
                    #meshEle.VertexColors.Add( color[0],color[1],color[2] );
            k = len(pointSection1[0])
            for i in range(0,len(pointSection1)-1):
                for j in range(0, len(pointSection1[0])):
                    if j < k-1:
                        index1 = i*k + j
                        index2 = (i+1)*k + j
                        index3 = index2 + 1
                        index4 = index1 + 1
                    elif j == k-1:
                        index1 = i*k + j
                        index2 = (i+1)*k + j
                        index3 = (i+1)*k
                        index4 = i*k
                    meshEle.Faces.AddFace(index1, index2, index3, index4)
                    #rs.ObjectColor(scyl,(255,0,0))
            colour = rs.CreateColor( color[0], color[1], color[2] )
            meshEle.VertexColors.CreateMonotoneMesh( colour )
            meshElement = meshEle
            
            return meshElement
        
        def gradient(value, valueMin, valueMax, colorList ):
    
            if colorList == [] :
                listcolor = [ rs.CreateColor( 201, 0, 0 ),
                            rs.CreateColor( 240, 69, 7),
                            rs.CreateColor( 251, 255, 0 ),
                            rs.CreateColor( 77, 255, 0 ),
                            rs.CreateColor( 0, 255, 221 ),
                            rs.CreateColor( 0, 81, 255 )]
            else :
                listcolor = colorList
    
            n = len( listcolor )
            domain = linspace( valueMin, valueMax, n)
            #print( domain )
            
            for i in range(1,n+1):
                if  domain[i-1] <= value <= domain[i] :
                    return listcolor[ i-1 ]
                elif  valueMax <= value <= valueMax + 0.0000000000001 :
                    return listcolor[ -1 ]
                elif  valueMin - 0.0000000000001 <= value <= valueMin  :
                    return listcolor[ 0 ]
        
        ## Mesh from close section eith gradient color ##
        def meshLoft4( point, value, valueMax, valueMin ):
            meshEle = rg.Mesh()
            for i in range(0,len(point)):
                color = gradientJet( value[i], valueMax, valueMin )
                for j in range(0, len(point[0])):
                    vertix = point[i][j]
                    meshEle.Vertices.Add( vertix ) 
                    meshEle.VertexColors.Add( color[0],color[1],color[2] );
            k = len(point[0])
            for i in range(0,len(point)-1):
                for j in range(0, len(point[0])):
                    if j < k-1:
                        index1 = i*k + j
                        index2 = (i+1)*k + j
                        index3 = index2 + 1
                        index4 = index1 + 1
                    elif j == k-1:
                        index1 = i*k + j
                        index2 = (i+1)*k + j
                        index3 = (i+1)*k
                        index4 = i*k
                    meshEle.Faces.AddFace(index1, index2, index3, index4)
            return meshEle
        
        
        def updateComponent(interval):
            
            ## Updates this component, similar to using a grasshopper timer 
            
            # Define callback action
            def callBack(e):
                ghenv.Component.ExpireSolution(False)
                
            # Get grasshopper document
            ghDoc = ghenv.Component.OnPingDocument()
            
            # Schedule this component to expire
            ghDoc.ScheduleSolution(interval,gh.Kernel.GH_Document.GH_ScheduleDelegate(callBack)) # Note that the first input here is how often to update the component (in milliseconds)
            
        #----------------------------------#
        def GroundMotionModelView(AlpacaGroundmotionOutput, speed, Animate, Reset, scale,direction, modelExtrude, colorList):
            
            
            global myCounter
            
            
            Animate = True if Animate is None else Animate
            Reset = False if Reset is None else Reset
            speed = 50 if speed is None else speed
            scale = 10 if scale is None else scale
            modelExtrude = True if modelExtrude is None else modelExtrude
            
            global ModelDisp
            global ModelCurve
            global ModelShell
            global ModelSolid
            global dimSection
            
            #-------------------------------------------------------------------------------------#
            path = AlpacaGroundmotionOutput[0].strip()
            EleOut = AlpacaGroundmotionOutput[1]
            point = AlpacaGroundmotionOutput[2]
            
            
            timeStep = []
            displacement = []
            
            start = time.clock()  
            
            
            with open(path, 'r') as f:
                lines = f.readlines()
                for n, line in enumerate(lines):
                    if (n % speed) == 0:
                        #print( n % speed )
                        line = line.strip().split(" ")
                        timeStep.append( line[0] )
                        displacementTemp = line[1:]
                        n = 6
                        displacementTime = [displacementTemp[i:i + n] for i in range(0, len(displacementTemp), n)]
                        displacement.append(displacementTime)
            
            
            # I change the List Structure to have an ouput
            # this change will not affect the work done before
            
            newDisplacement = [[row[i] for row in displacement] for i in range(len(displacement[0]))]
            
            trans = []
            rot = []
            for nodeDispCollection in newDisplacement:
                transTemp = []
                rotTemp = []
                for nodeDisp in nodeDispCollection:
                    transTemp.append(rg.Vector3d(float(nodeDisp[0]),float(nodeDisp[1]),float(nodeDisp[2])))
                    rotTemp.append(rg.Vector3d(float(nodeDisp[3]),float(nodeDisp[4]),float(nodeDisp[5])))
                trans.append(transTemp)
                rot.append(rotTemp)
            
            #for item in newDisplacement
            
            trans = th.list_to_tree(trans)
            rot = th.list_to_tree(rot)
            
            
            
            
            #print(time.clock() - start)
            
            if "myCounter" not in globals() or Reset:
                myCounter = 0
            
            if Animate and not Reset:
                if myCounter >= len(displacement) - 1:
                    myCounter = 0
                else:
                    myCounter += 1
                updateComponent(1)
            
            
            stepValue = displacement[myCounter]
            
            pointDef = []
            for indexPoint, value in enumerate(stepValue):
                tagPoint = indexPoint  + 1
                #print( tagPoint )
                traslX = float(value[0])
                traslY = float(value[1])
                traslZ = float(value[2])
                rotX = float(value[3]) 
                rotY = float(value[4])
                rotZ = float(value[5])
                pointDef.append([ tagPoint, [ rg.Point3d( traslX, traslY, traslZ ), rg.Point3d( rotX, rotY, rotZ ) ]])
            timePointDef = dict( pointDef )
            
            
            nodeValue = []
            #ShellOut = AlpacaGroundmotionOutput[4]
            
            pointWrapper = []
            
            for value in point:
                index = value[0] 
                #print( index )
                pointWrapper.append( [index, rg.Point3d(value[1][0],value[1][1],value[1][2]) ] )
            
            ## Dict. for point ##
            pointWrapperDict = dict( pointWrapper )
            ####
            scaleDef = scale
            
            modelCurve = []
            ShellDefModel = []
            ExtrudedView = []
            modelDisp = []
            
            traslBeamValue = []
            rotBeamValue = []
            
            traslShellValue = []
            rotShellValue = []
            ExtrudedShell = []
            
            SolidDefModel = []
            traslSolidValue = []
            
            #print( timePointDef[A] )
            for ele in EleOut :
                eleType = ele[2][0]
                nNode = len( ele[1] )
                
                if eleType == 'ElasticTimoshenkoBeam' :
                    
                    dimSection = ele[2][10]
                    valueTBeam = defValueTimoshenkoBeam( ele, pointWrapperDict, timePointDef, scaleDef )
                    defpolyline = valueTBeam[0]
                    meshdef = valueTBeam[1]
                    globalTrans = valueTBeam[2]
                    globalRot = valueTBeam[3]
                    traslBeamValue.append( globalTrans ) 
                    rotBeamValue.append( globalRot )
                    modelCurve.append( defpolyline )
                    modelDisp.append( defpolyline )
                    # estrusione della beam #
                    ExtrudedView.append( meshdef )
                    #doc.Objects.AddMesh( meshdef )
                elif eleType == 'Truss' :
                    dimSection = ele[2][10]
                    #print( color )
                    valueTruss = defTruss( ele, pointWrapperDict, timePointDef, scaleDef )
                    defpolyline = valueTruss[0]
                    meshdef = valueTruss[1]
                    globalTrans = valueTruss[2]
                    traslBeamValue.append( globalTrans ) 
                    modelCurve.append( defpolyline )
                    modelDisp.append( defpolyline )
                    ExtrudedView.append( meshdef )
                    #doc.Objects.AddMesh( meshdef )
            
                elif nNode == 4 and eleType != 'FourNodeTetrahedron':
                    shellDefModel = defShellQuad( ele, pointWrapperDict, timePointDef, scaleDef )
                    ShellDefModel.append( shellDefModel[0] )
                    traslShellValue.append( shellDefModel[1] )
                    rotShellValue.append( shellDefModel[2] )
                    extrudeShell = shellDefModel[3]
                    ExtrudedView.append( extrudeShell )
            
                    
                elif nNode == 3:
                    #print( nNode )
                    shellDefModel = defShellTriangle( ele, pointWrapperDict, timePointDef, scaleDef )
                    ShellDefModel.append( shellDefModel[0] )
                    traslShellValue.append( shellDefModel[1] )
                    rotShellValue.append( shellDefModel[2] )
                    extrudeShell = shellDefModel[3]
                    ExtrudedView.append( extrudeShell )
                    
                elif nNode == 8:
                    solidDefModel = defSolid( ele, pointWrapperDict, timePointDef, scaleDef)
                    SolidDefModel.append( solidDefModel[0] )
                    traslSolidValue.append( solidDefModel[1] )
                    ExtrudedView.append( solidDefModel[0] )
                    
                elif  eleType == 'FourNodeTetrahedron' :
                    #print(ele)
                    solidDefModel = defTetraSolid( ele, pointWrapperDict, timePointDef, scaleDef )
                    SolidDefModel.append( solidDefModel[0] )
                    traslSolidValue.append( solidDefModel[1] )
                    ExtrudedView.append( solidDefModel[0] )
            
         ########################################################################################################################
            # MAX an MIN VALOR
            valorVector = []
            # beam valor #
            for valuetrasl in traslBeamValue:
                for valor in valuetrasl:
                    vectorTrasl = rg.Vector3d( valor )
                    if direction == 0:
                        valorVector.append( vectorTrasl.X ) 
                    elif direction == 1:
                        valorVector.append( vectorTrasl.Y )
                    elif direction == 2:
                        valorVector.append( vectorTrasl.Z ) 
                    elif direction == 3:
                        valorVector.append( vectorTrasl.Length )     
            # POINT #
            
            PointPos = [row[1] for row in pointWrapper ]
            if len(pointDef[0][1]) == 3 :
                PointDisp = [row[1] for row in pointDef ] 
            else:
                PointDisp = [row[1][0] for row in pointDef ]
        
            for nodeDisp in PointDisp :
                vectorNodeDisp = rg.Vector3d( nodeDisp )
                if direction == 0:
                    valorVector.append( vectorNodeDisp.X ) 
                elif direction == 1:
                    valorVector.append( vectorNodeDisp.Y )
                elif direction == 2:
                    valorVector.append( vectorNodeDisp.Z ) 
                elif direction == 3:
                    valorVector.append( vectorNodeDisp.Length )
                    
            # MAX end MIN on structures point #
            lowerLimit = min( valorVector )
            upperLimit = max( valorVector )
            domainValues = [ lowerLimit, upperLimit ]
            print( lowerLimit, upperLimit )
        #####################################################################################
            colorBeam = []
            numberDivide = []
            for value in traslBeamValue :
                colorValor = []
                for valor in value:
                    vectorTrasl = rg.Vector3d( valor )
        
                    if direction == 0:
                        valorVector = vectorTrasl.X  
                    elif direction == 1:
                        valorVector = vectorTrasl.Y 
                    elif direction == 2:
                        valorVector = vectorTrasl.Z  
                    elif direction == 3:
                        valorVector = vectorTrasl.Length
        
                    #print( valorVector )
        
                    color = gradient( valorVector, lowerLimit, upperLimit, colorList )
                    colorValor.append( color )
                colorBeam.append( colorValor )
                numberDivide.append( len(colorValor) )
            #print( modelCurve[0])
            segment = []
            for curve, segmentCount in zip( modelCurve, numberDivide ):
                #print(segmentCount)
                parameter = curve.DivideByCount( segmentCount - 1, True )
                segmentCurve = []
                for i in range(1, len(parameter)) :
                        p1 =  rg.Curve.PointAt( curve, parameter[i-1] ) 
                        p2 = rg.Curve.PointAt( curve, parameter[i] )
                        segmentCurve.append( rg.Line( p1, p2 ) )
                segment.append( segmentCurve )
        
                #print( segment )
        
            
            for shellEle, value in zip(ShellDefModel,traslShellValue) :
                shellColor = shellEle.DuplicateMesh()
                shellColor.VertexColors.Clear()
                for j in range( 0,shellEle.Vertices.Count ):
                    vectorTrasl = rg.Vector3d( value[j] )
                    if direction == 0:
                        valorVector = vectorTrasl.X  
                    elif direction == 1:
                        valorVector = vectorTrasl.Y 
                    elif direction == 2:
                        valorVector = vectorTrasl.Z  
                    elif direction == 3:
                        valorVector = vectorTrasl.Length
        
                    color = gradient( valorVector, lowerLimit, upperLimit, colorList )
                    shellColor.VertexColors.Add( color )
                modelDisp.append( shellColor)
            #dup.VertexColors.CreateMonotoneMesh(Color.Red)
            #doc.Objects.AddMesh(dup)
            for solidEle, value in zip(SolidDefModel,traslSolidValue) :
                solidColor = solidEle.DuplicateMesh()
                solidColor.VertexColors.Clear()
                for j in range(0,solidEle.Vertices.Count):
                    vectorTrasl = rg.Vector3d( value[j] )
                    if direction == 0:
                        valorVector = vectorTrasl.X  
                    elif direction == 1:
                        valorVector = vectorTrasl.Y 
                    elif direction == 2:
                        valorVector = vectorTrasl.Z  
                    elif direction == 3:
                        valorVector = vectorTrasl.Length
        
                    color = gradient( valorVector, lowerLimit, upperLimit, colorList )
                    solidColor.VertexColors.Add( color )
                modelDisp.append( solidColor )
                    #rg.Collections.MeshVertexColorList.SetColor( solidEle,j, color[0], color[1], color[2] )
        
        
            
            if modelExtrude == False or modelExtrude == None :
                self.line = segment
                self.colorLine = colorBeam
                return modelDisp, PointPos, PointDisp, domainValues, trans
                
            else:
                self.line = []
                self.colorLine = []
                return ExtrudedView, PointPos, PointDisp, domainValues, trans
        
        
        
        checkData = True
        
        if not AlpacaGroundmotionOutput:
            checkData = False
            msg = "input 'AlpacaGroundmotionOutput' failed to collect data"
            ghenv.Component.AddRuntimeMessage(gh.Kernel.GH_RuntimeMessageLevel.Warning, msg)
        
        
        if checkData != False:
            modelDisp, PointPos, PointDisp, domainValues, trans = GroundMotionModelView(AlpacaGroundmotionOutput, speed, Animate, Reset, scale, direction, modelExtrude, colorList )
            return (modelDisp, PointPos, PointDisp, domainValues, trans)
            
    def DrawViewportWires(self,arg):
        
        for crvs, colors in zip(self.line, self.colorLine):
            for crv, color in zip(crvs, colors):
                arg.Display.DrawLine(crv, color, 4)
# ---------- end ghpython_script_36 ----------
list_item_2 = ListItem(List=tree_statistics.Paths, Index=Slider(0, range=0..10), Wrap=True)
tree_branch = TreeBranch(Tree=beam_forces_karamba3d.NormalForce_kN, Path=list_item_2, MaintainPaths=True)
geometry_5 = Geometry(ghpython_script_36.modelDisp)  # disabled
panel_34 = Panel(tree_branch)
merge_14 = Merge(Data1=analyze_3.AlpacaStaticOutput, Data2=analyze_4.AlpacaStaticOutput)  # -> flatten(Result); disabled
panel_35 = Panel(analyze_6.MassPart)  # disabled
quick_graph_3 = QuickGraph(analyze_6.Spectrum, SortOrder=0)  # disabled
cluster = Cluster_2(A=analyze_6.PossNodeForce, x_component=0, y_component=analyze_6.ForceY, B=number_slider_17)  # disabled
cluster_2 = Cluster_2(A=analyze_6.PossNodeForce, x_component=analyze_6.ForceX, y_component=0, B=number_slider_17)  # disabled

# ---- group: Beam Forces
# CDS valor
number_slider_24 = Slider(10, range=0..10)
file_path_30 = FilePath("C:\GitHub\Alpaca4d\PythonScript\Post-Processing\beamForces\beamForces.py")
# beam Component
read_file_30 = ReadFile(File=file_path_30, PerLineParse=False)
ghpython_script_37 = GhPythonScript(Code=read_file_30, AlpacaStaticOutput=analyze_3.AlpacaStaticOutput)  # -> Out, TagElement, N, V1, V2, Mt, M1, M2

# ---- group: Cds Visualisation
# CDS view
file_path_31 = FilePath("C:\GitHub\Alpaca4d\PythonScript\Post-Processing\cdsView\cdsView.py")
value_list_9 = ValueList({"N", "V1", "V2", "M2", "M1", "Mt"}, selected="V2")
read_file_31 = ReadFile(File=file_path_31, PerLineParse=False)
ghpython_script_38 = GhPythonScript(Code=read_file_31, AlpacaStaticOutput=analyze_3.AlpacaStaticOutput, SectionForces=value_list_9)

# ---- group: Reaction Forces
# Reactions
number_slider_25 = Slider(2.28, range=0..10)  # disabled
boolean_toggle_7 = BooleanToggle(False)  # disabled
boolean_toggle_8 = BooleanToggle(False)  # disabled
ghpython_script_39 = GhPythonScript(
    AlpacaStaticOutput=analyze_3.AlpacaStaticOutput,
    reactionForcesView=boolean_toggle_8,
    reactionMomentsView=boolean_toggle_7,
    scale=number_slider_25)  # -> tagPoints, ReactionForce, ReactionMoment; inputs AlpacaStaticOutput: list, reactionForcesView: Boolean, reactionMomentsView: Boolean; disabled
# ---------- ghpython_script_39: Python ----------
"""Compute the Reaction Forces
            Inputs:
                AlpacaStaticOutput: Output of static Analyses Solver.
                reactionForcesView : True - view reaction Forces.
                reactionMomentsView : True - view reaction Moments.
                scale: number that multiplies the reaction.
            Output:
               tagPoints :  nodes tag of Model.
               ReactionForce : Vector of reaction Forces { Rx, Ry, Rz }.
               ReactionMoment : Vector of reaction Moments { Mx, My, Mz }.
"""


from ghpythonlib.componentbase import executingcomponent as component
import Grasshopper, GhPython
import System
import Rhino
import rhinoscriptsyntax as rs
import Rhino.Geometry as rg

class MyComponent(component):
    
    def RunScript(self, AlpacaStaticOutput, reactionForcesView, reactionMomentsView, scale):
        
        import Rhino.Geometry as rg
        import math
        import ghpythonlib.treehelpers as th # per data tree
        import Grasshopper as gh
        import sys
        
        
        
        #---------------------------------------------------------------------------------------#
        def reaction(AlpacaStaticOutput, scale, reactionForceView = False, reactionMomentsView = False):
        
            # define output
        
            global tagPoints
            global ReactionForce
            global ReactionMoment
            global view
        
            reactionForceView = False if reactionForceView is None else reactionForceView
            reactionMomentsView = False if reactionMomentsView is None else reactionMomentsView
        
            if scale is None :
                scale = 1
        
        
            diplacementWrapper = AlpacaStaticOutput[0]
            reactionOut = AlpacaStaticOutput[1]
            #print( len( reactionOut ) )
        
            pointWrapper = []
        
            for index,item in enumerate(diplacementWrapper):
                pointWrapper.append( [index, rg.Point3d(item[0][0],item[0][1],item[0][2]) ] )
        
            ## Dict. for point ##
            pointWrapperDict = dict( pointWrapper )
        
            ## per scalare le reazioni #
            rowReaction = [row[1] for row in reactionOut ]
        
            valorReaction = []
            for valor in rowReaction:
                rx = math.fabs( valor[0] )
                ry = math.fabs( valor[1] )
                rz = math.fabs( valor[2] )
                mx = math.fabs( valor[3] )
                my = math.fabs( valor[4] )
                mz = math.fabs( valor[5] )
                valorReaction.append( [ rx, ry, rz, mx, my, mz ] )
        
            rx = max([row[0] for row in valorReaction ])
            ry = max([row[1] for row in valorReaction ])
            rz = max([row[2] for row in valorReaction ])
            mx = max([row[3] for row in valorReaction ])
            my = max([row[4] for row in valorReaction ])
            mz = max([row[5] for row in valorReaction ])
            # -------------------------------------------------------#
        
            ReactionForce = []
            ReactionMoment = []
            viewElement = []
            tagPoints = []
            for value in reactionOut:
                pointIndex = value[0]
                tagPoints.append( pointIndex )
                point = pointWrapperDict.get( pointIndex , "never")
                Rx = rg.Vector3d( value[1][0], 0, 0 )
                Ry = rg.Vector3d( 0,value[1][1], 0 )
                Rz = rg.Vector3d( 0,0, value[1][2] )
                Mx = rg.Vector3d( value[1][3], 0, 0 )
                My = rg.Vector3d( 0, value[1][4], 0 )
                Mz = rg.Vector3d( 0,0, value[1][5] )
                Rxyz = Rx + Ry + Rz
                Mxyz = Mx + My + Mz
                viewElement.append( [ point, Rx/rx*scale, Ry/ry*scale, Rz/rz*scale, Mx/mx*scale, My/my*scale, Mz/mz*scale ] )
                ReactionForce.append( Rxyz )
                ReactionMoment.append( Mxyz )
        
            point = [row[0] for row in viewElement ]
            Rx = [row[1] for row in viewElement ]
            Ry = [row[2] for row in viewElement ]
            Rz = [row[3] for row in viewElement ]
            Mx = [row[4] for row in viewElement ]
            My = [row[5] for row in viewElement ]
            Mz = [row[6] for row in viewElement ]
            
            
            self.point = point if reactionForcesView or reactionMomentsView == True else []
            self.Rx = Rx if reactionForcesView == True else []
            self.Ry = Ry if reactionForcesView == True else []
            self.Rz = Rz if reactionForcesView == True else []
            self.Mx = Mx if reactionMomentsView == True else []
            self.My = My if reactionMomentsView == True else []
            self.Mz = Mz if reactionMomentsView == True else []
            
            null = [rg.Vector3d( 0, 0, 0 )]*len(Rx)
        
            if reactionForcesView == True and reactionMomentsView == False or reactionForcesView == None and reactionMomentsView == False :
                view = th.list_to_tree( [ point, Rx, Ry, Rz, null, null, null ]  )
            elif reactionForcesView == False and reactionMomentsView == True or reactionForcesView == False and reactionMomentsView == None :
                view = th.list_to_tree( [ point, null, null, null, Mx, My, Mz ]   )
            elif reactionForcesView == True and reactionMomentsView == True or reactionForcesView == None and reactionMomentsView == None :
                view = th.list_to_tree( [ point, Rx, Ry, Rz,Mx, My, Mz ]  )
        
            return tagPoints, ReactionForce, ReactionMoment
        
        checkData = True
        
        if not AlpacaStaticOutput :
            checkData = False
            msg = "input 'AlpacaStaticOutput' failed to collect data"
            ghenv.Component.AddRuntimeMessage(gh.Kernel.GH_RuntimeMessageLevel.Warning, msg)
        
        if checkData != False :
            tagPoints, ReactionForce, ReactionMoments = reaction( AlpacaStaticOutput, scale, reactionForcesView, reactionMomentsView  )
            return (tagPoints, ReactionForce, ReactionMoment)

    def DrawViewportWires(self,arg):
        
        for ancor, forceX, forceY, forceZ in zip(self.point, self.Rx, self.Ry, self.Rz):
            arg.Display.DrawArrow( rg.Line(ancor, forceX) ,  System.Drawing.Color.Black)
            arg.Display.DrawArrow( rg.Line(ancor, forceY) ,  System.Drawing.Color.Black)
            arg.Display.DrawArrow( rg.Line(ancor, forceZ) ,  System.Drawing.Color.Black)
        
        for ancor, momentX, momentY, momentZ in zip(self.point, self.Mx, self.My, self.Mz):
            arg.Display.DrawArrow( rg.Line(ancor, momentX) ,  System.Drawing.Color.Red)
            arg.Display.DrawArrow( rg.Line(ancor, momentY) ,  System.Drawing.Color.Red)
            arg.Display.DrawArrow( rg.Line(ancor, momentZ) ,  System.Drawing.Color.Red)
# ---------- end ghpython_script_39 ----------

# ---- group: shell Forces
# Forces valor
file_path_32 = FilePath("C:\GitHub\Alpaca4d\PythonScript\Post-Processing\shellForces\shellForces.py")  # disabled
read_file_32 = ReadFile(File=file_path_32, PerLineParse=False)  # disabled
ghpython_script_40 = GhPythonScript(Code=read_file_32, AlpacaStaticOutput=analyze_3.AlpacaStaticOutput)  # -> Out, TagElement, Fx, Fy, Fz, Mx, My, Mz; disabled

# ----
# Brick component
# Stress view & valor
file_path_33 = FilePath("C:\GitHub\Alpaca4d\PythonScript\Post-Processing\brickStress\brickStress.py")  # disabled
value_list_10 = ValueList({"sigmaX": 0, "sigmaY": 1, "sigmaZ": 2, "tauXY": 3, "tauXZ": 4, "tauYZ": 5}, selected="tauYZ")  # disabled
read_file_33 = ReadFile(File=file_path_33, PerLineParse=False)  # disabled
ghpython_script_41 = GhPythonScript(Code=read_file_33, AlpacaStaticOutput=analyze_4.AlpacaStaticOutput, StressView=value_list_10)  # -> Brick, StressValue, DomainValues; disabled

list_item_3 = ListItem(List=ghpython_script_36.domainValues, Index=0, Wrap=True)  # -> Item, Item1; disabled

# ----
# Forces view
file_path_34 = FilePath("C:\GitHub\Alpaca4d\PythonScript\Post-Processing\shellForceView\shellForceView.py")  # disabled
value_list_11 = ValueList({"Face1": 0, "Face2": 1, "Face3": 2, "Face4": 3}, selected="Face1")  # disabled
value_list_12 = ValueList({"Fx": 0, "Fy": 1, "Fz": 2, "Mx": 3, "My": 4, "Mz": 5}, selected="Fx")  # disabled
read_file_34 = ReadFile(File=file_path_34, PerLineParse=False)  # disabled
ghpython_script_42 = GhPythonScript(Code=read_file_34, AlpacaStaticOutput=analyze_3.AlpacaStaticOutput, ViewForce=value_list_12, Face=value_list_11)  # -> Shell, ForceValue, DomainValues; disabled

merge_15 = Merge(Data1=analyze_3.AlpacaStaticOutput, Data2=analyze_4.AlpacaStaticOutput)  # -> flatten(Result)

# ---- group: Shell Stress Visualisation
# Stress view & valor
file_path_35 = FilePath("C:\GitHub\Alpaca4d\PythonScript\Post-Processing\shellStressView\shellStressView.py")  # disabled
value_list_13 = ValueList({"pxx": 0, "pyy": 1, "pxy": 2, "txz": 3, "tyz": 4, "mxx": 5, "myy": 6, "mxy": 7}, selected="tyz")  # disabled
read_file_35 = ReadFile(File=file_path_35, PerLineParse=False)  # disabled
ghpython_script_43 = GhPythonScript(Code=read_file_35, AlpacaStaticOutput=analyze_3.AlpacaStaticOutput, StressView=value_list_13, ColorList=merge_5)  # -> Shell, StressValue, DomainValues; disabled

# ----
list_item_4 = ListItem(List=ghpython_script_36.PointPos, Index=number_slider_18, Wrap=True)  # disabled
list_item_5 = ListItem(List=ghpython_script_36.PointDisp, Index=number_slider_18, Wrap=True)  # disabled
vector_8 = Vector(list_item_5)  # disabled
data_recorder = DataRecorder(list_item_3.Item1, DataLimit=-10, RecordData=True)  # disabled
data_recorder_2 = DataRecorder(list_item_5, DataLimit=-10, RecordData=True)  # disabled
multiplication_4 = Multiplication(A=vector_8, B=number_slider_15)  # disabled
move_12 = Move(Geometry=list_item_4, Motion=multiplication_4)  # -> Geometry, Transform; disabled

# ----
# deformedModelView
# OK!
number_slider_26 = Slider(4607, range=0..10000)
value_list_14 = ValueList({"tx": 0, "ty": 1, "tz": 2, "txyz": 3}, selected="txyz")
boolean_toggle_9 = BooleanToggle(False)
data_21 = Data(merge_15)
ghpython_script_44 = GhPythonScript(AlpacaStaticOutput=data_21, scale=number_slider_26, modelExtrude=boolean_toggle_9)  # -> modelDisp, domainValues; inputs AlpacaStaticOutput: list, modelExtrude: Boolean, direction: Int32, colorList: list of Color
# ---------- ghpython_script_44: Python ----------
"""Generate Model view 
    Inputs:
        AlpacaStaticOutput: Output of solver on static Analyses.
        scale: multiplication factor for displacement.
        modelExtrud: True - view extruded model.
        direction : view relative color of the traslation:
            '0' view traslation X.
            '1' view traslation Y.
            '2' view traslation Z.
            '3' view resulting displacement.


    Output:
       modelDisp: view deformed model
       domainValues: max end min of displacement of the structure .
"""


from ghpythonlib.componentbase import executingcomponent as component
import Grasshopper, GhPython
import System
import Rhino
import rhinoscriptsyntax as rs

class MyComponent(component):
    
    def RunScript(self, AlpacaStaticOutput, scale, modelExtrud, direction, colorList):
        
        import Rhino as rc
        import Rhino.Geometry as rg
        import math
        import ghpythonlib.treehelpers as th # per data tree
        import Grasshopper as gh
        import sys
        import rhinoscriptsyntax as rs
        import Rhino.Display as rd
        from scriptcontext import sticky as st
        import System.Drawing.Color
        import scriptcontext as sc
        
        
        
        def alphat( E, G, I, At ):
            return (E*I)/(G*At)
        
        ## Spostamenti e rotazioni ##
        def spostu( x, L, uI, uJ ):
            return -(-L*uI + uI*x - uJ*x)/L
            
        def spostv( x, L, vI, vJ, thetaI, thetaJ, alphay ):
            return (L**3*thetaI*x + L**3*vI - 2*L**2*thetaI*x**2 - L**2*thetaJ*x**2 + 6*L*alphay*thetaI*x - 6*L*alphay*thetaJ*x + 12*L*alphay*vI + L*thetaI*x**3 + L*thetaJ*x**3 - 3*L*vI*x**2 + 3*L*vJ*x**2 - 6*alphay*thetaI*x**2 + 6*alphay*thetaJ*x**2 - 12*alphay*vI*x + 12*alphay*vJ*x + 2*vI*x**3 - 2*vJ*x**3)/(L*(L**2 + 12*alphay))
            
        def spostw( x, L, wI, wJ, psiI, psiJ, alphaz ):
            return -(L**3*psiI*x - L**3*wI - 2*L**2*psiI*x**2 - L**2*psiJ*x**2 - 6*L*alphaz*psiI*x + 6*L*alphaz*psiJ*x + 12*L*alphaz*wI + L*psiI*x**3 + L*psiJ*x**3 + 3*L*wI*x**2 - 3*L*wJ*x**2 + 6*alphaz*psiI*x**2 - 6*alphaz*psiJ*x**2 - 12*alphaz*wI*x + 12*alphaz*wJ*x - 2*wI*x**3 + 2*wJ*x**3)/(L*(L**2 - 12*alphaz))
            
        def thetaz(x, L, vI, vJ, thetaI, thetaJ, alphay): 
            return (L**3*thetaI - 4*L**2*thetaI*x - 2*L**2*thetaJ*x + 12*L*alphay*thetaI + 3*L*thetaI*x**2 + 3*L*thetaJ*x**2 - 6*L*vI*x + 6*L*vJ*x - 12*alphay*thetaI*x + 12*alphay*thetaJ*x + 6*vI*x**2 - 6*vJ*x**2)/(L*(L**2 + 12*alphay))
            
        def phix(x, L, phiI, phiJ):
            return -(-L*phiI + phiI*x - phiJ*x)/L
        
        def psiy(x, L, wI, wJ, psiI, psiJ, alphaz): 
            return (L**3*psiI - 4*L**2*psiI*x - 2*L**2*psiJ*x - 12*L*alphaz*psiI + 3*L*psiI*x**2 + 3*L*psiJ*x**2 + 6*L*wI*x - 6*L*wJ*x + 12*alphaz*psiI*x - 12*alphaz*psiJ*x - 6*wI*x**2 + 6*wJ*x**2)/(L*(L**2 - 12*alphaz))
            
        def gammay( L, vI, vJ, thetaI, thetaJ, alphay): 
        
            return (L*thetaI + L*thetaJ + 2*vI - 2*vJ)/(L*(L**2 + 12*alphay))
            
        def gammaz( L, wI, wJ, psiI, psiJ, alphaz):
        
            return -(L*psiI + L*psiJ - 2*wI + 2*wJ)/(L*(L**2 - 12*alphaz))
        
        ##------------------------------------------------------------------------- --##
        
        def scaleAutomatic( Num , Den ):
            if Den < 0.1 :
                return Num
            else :
                return Num*1/Den
        
        def linspace(a, b, n=100):
            if n < 2:
                return b
            diff = (float(b) - a)/(n - 1)
            return [diff * i + a  for i in range(n)]
        
        ## Funzione rettangolo ##
        def AddRectangleFromCenter(plane, width, height):
            a = plane.PointAt(-width * 0.5, -height * 0.5 )
            b = plane.PointAt(-width * 0.5,  height * 0.5 )
            c = plane.PointAt( width * 0.5,  height * 0.5 )
            d = plane.PointAt( width * 0.5,  -height * 0.5 )
            #rectangle = rg.PolylineCurve( [a, b, c, d, a] )
            rectangle  = [a, b, c, d] 
            return rectangle
            
        ## Funzione cerchio ##
        def AddCircleFromCenter( plane, radius):
            t = linspace( 0 , 1.80*math.pi, 16 )
            a = []
            for ti in t:
                x = radius*math.cos(ti)
                y = radius*math.sin(ti)
                a.append( plane.PointAt( x, y ) )
            #circle = rg.PolylineCurve( a )
            circle  = a 
            return circle
        
        def AddIFromCenter(plane, Bsup, tsup, Binf, tinf, H, ta, yg):
            #-------------------1---------2 #
            p1 = plane.PointAt( -(yg - tinf), ta/2 )
            p2 = plane.PointAt( -(yg - tinf), Binf/2 )
            p3 = plane.PointAt( -yg, Binf/2 )
            p4 = plane.PointAt( -yg, -Binf/2 )
            p5 = plane.PointAt( -(yg - tinf), -Binf/2 ) 
            p6 = plane.PointAt( -(yg - tinf), -ta/2 )
            p7 = plane.PointAt( (H - yg - tsup), -ta/2)
            p8 = plane.PointAt( (H - yg - tsup), -Bsup/2 )
            p9 = plane.PointAt( (H - yg ), -Bsup/2 )
            p10 = plane.PointAt( (H - yg ), Bsup/2 )
            p11 = plane.PointAt( (H - yg - tsup), Bsup/2 )
            p12 = plane.PointAt( (H - yg - tsup), ta/2 )
        
            wirframe  = [ p1, p2, p3, p4, p5, p6, p7, p8, p9, p10, p11, p12 ] 
            return wirframe
        
        def defShellQuad( ele, node, nodeDisp, scaleDef ):
            
            eleTag = ele[0]
            eleNodeTag = ele[1]
            color = ele[2][2]
            thick = ele[2][1]
            index1 = eleNodeTag[0]
            index2 = eleNodeTag[1]
            index3 = eleNodeTag[2]
            index4 = eleNodeTag[3]
            
            trasl1 = nodeDisp.get( index1 -1 , "never")[0]
            rotate1 = nodeDisp.get( index1 -1 , "never")[1]
            
            trasl2 = nodeDisp.get( index2 -1 , "never")[0]
            rotate2 = nodeDisp.get( index2 -1 , "never")[1]
            
            trasl3 = nodeDisp.get( index3 -1 , "never")[0]
            rotate3 = nodeDisp.get( index3 -1 , "never")[1]
            
            trasl4 = nodeDisp.get( index4 -1 , "never")[0]
            rotate4 = nodeDisp.get( index4 -1 , "never")[1]
            
            ## CREO IL MODELLO DEFORMATO  ##
            
            pointDef1 = rg.Point3d.Clone( node.get( index1 -1 , "never") )
            pointDef2 = rg.Point3d.Clone( node.get( index2 -1 , "never") )
            pointDef3 = rg.Point3d.Clone( node.get( index3 -1 , "never") )
            pointDef4 = rg.Point3d.Clone( node.get( index4 -1 , "never") )
            vectortrasl1 = rg.Transform.Translation( rg.Vector3d(trasl1.X, trasl1.Y, trasl1.Z)*scaleDef )
            pointDef1.Transform( vectortrasl1 )
            vectortrasl2 = rg.Transform.Translation( rg.Vector3d(trasl2.X, trasl2.Y, trasl2.Z)*scaleDef )
            pointDef2.Transform( vectortrasl2 )
            vectortrasl3 = rg.Transform.Translation( rg.Vector3d(trasl3.X, trasl3.Y, trasl3.Z)*scaleDef )
            pointDef3.Transform( vectortrasl3 )
            vectortrasl4 = rg.Transform.Translation( rg.Vector3d(trasl4.X, trasl4.Y, trasl4.Z)*scaleDef )
            pointDef4.Transform( vectortrasl4 )
            shellDefModel = rg.Mesh()
            shellDefModel.Vertices.Add( pointDef1 ) #0
            shellDefModel.Vertices.Add( pointDef2 ) #1
            shellDefModel.Vertices.Add( pointDef3 ) #2
            shellDefModel.Vertices.Add( pointDef4 ) #3
            
            
            shellDefModel.Faces.AddFace(0, 1, 2, 3)
            colour = rs.CreateColor( color[0], color[1], color[2] )
            shellDefModel.VertexColors.CreateMonotoneMesh( colour )
        
            vt = shellDefModel.Vertices
            shellDefModel.FaceNormals.ComputeFaceNormals()
            fid,MPt = shellDefModel.ClosestPoint(vt[0],0.01)
            normalFace = shellDefModel.FaceNormals[fid]
            vectormoltiplicate = rg.Vector3d.Multiply( -normalFace, thick/2 )
            trasl = rg.Transform.Translation( vectormoltiplicate )
            moveShell = rg.Mesh.DuplicateMesh(shellDefModel)
            moveShell.Transform( trasl )
            extrudeShell = rg.Mesh.Offset( moveShell, thick, True, normalFace)
            return  [shellDefModel,[trasl1, trasl2, trasl3, trasl4], [rotate1, rotate2, rotate3, rotate4], extrudeShell ]
        
        def defShellTriangle( ele, node, nodeDisp, scaleDef ):
            
            eleTag = ele[0]
            eleNodeTag = ele[1]
            color = ele[2][2]
            thick = ele[2][1]
            index1 = eleNodeTag[0]
            index2 = eleNodeTag[1]
            index3 = eleNodeTag[2]
            
            trasl1 = nodeDisp.get( index1 -1 , "never")[0]
            rotate1 = nodeDisp.get( index1 -1 , "never")[1]
            
            trasl2 = nodeDisp.get( index2 -1 , "never")[0]
            rotate2 = nodeDisp.get( index2 -1 , "never")[1]
            
            trasl3 = nodeDisp.get( index3 -1 , "never")[0]
            rotate3 = nodeDisp.get( index3 -1 , "never")[1]
            
            ## CREO IL MODELLO DEFORMATO  ##
            pointDef1 = rg.Point3d.Clone( node.get( index1 -1 , "never") )
            pointDef2 = rg.Point3d.Clone( node.get( index2 -1 , "never") )
            pointDef3 = rg.Point3d.Clone( node.get( index3 -1 , "never") )
            vectortrasl1 = rg.Transform.Translation( rg.Vector3d(trasl1.X, trasl1.Y, trasl1.Z)*scaleDef )
            pointDef1.Transform( vectortrasl1 )
            vectortrasl2 = rg.Transform.Translation( rg.Vector3d(trasl2.X, trasl2.Y, trasl2.Z)*scaleDef )
            pointDef2.Transform( vectortrasl2 )
            vectortrasl3 = rg.Transform.Translation( rg.Vector3d(trasl3.X, trasl3.Y, trasl3.Z)*scaleDef )
            pointDef3.Transform( vectortrasl3 )
            shellDefModel = rg.Mesh()
            shellDefModel.Vertices.Add( pointDef1 ) #0
            shellDefModel.Vertices.Add( pointDef2 ) #1
            shellDefModel.Vertices.Add( pointDef3 ) #2
            
            shellDefModel.Faces.AddFace(0, 1, 2)
            colour = rs.CreateColor( color[0], color[1], color[2] )
            shellDefModel.VertexColors.CreateMonotoneMesh( colour )
        
        
            vt = shellDefModel.Vertices
            shellDefModel.FaceNormals.ComputeFaceNormals()
            fid,MPt = shellDefModel.ClosestPoint(vt[0],0.01)
            normalFace = shellDefModel.FaceNormals[fid]
            vectormoltiplicate = rg.Vector3d.Multiply( -normalFace, thick/2 )
            trasl = rg.Transform.Translation( vectormoltiplicate )
            moveShell = rg.Mesh.DuplicateMesh(shellDefModel)
            moveShell.Transform( trasl )
            extrudeShell = rg.Mesh.Offset( moveShell, thick, True, normalFace)
            return  [shellDefModel,[trasl1, trasl2, trasl3], [rotate1, rotate2, rotate3], extrudeShell ]
        
        def defSolid( ele, node, nodeDisp, scaleDef ):
            
            eleTag = ele[0]
            eleNodeTag = ele[1]
            color = ele[2][1]
            thick = ele[2][1]
            #print( eleNodeTag )
            index1 = eleNodeTag[0]
            index2 = eleNodeTag[1]
            index3 = eleNodeTag[2]
            index4 = eleNodeTag[3]
            index5 = eleNodeTag[4]
            index6 = eleNodeTag[5]
            index7 = eleNodeTag[6]
            index8 = eleNodeTag[7]
            
            trasl1 = nodeDisp.get( index1 -1 , "never")
            trasl2 = nodeDisp.get( index2 -1 , "never")
            trasl3 = nodeDisp.get( index3 -1 , "never")
            trasl4 = nodeDisp.get( index4 -1 , "never")
            trasl5 = nodeDisp.get( index5 -1 , "never")
            trasl6 = nodeDisp.get( index6 -1 , "never")
            trasl7 = nodeDisp.get( index7 -1 , "never")
            trasl8 = nodeDisp.get( index8 -1 , "never")
            #print( trasl1 )
            ## CREO IL MODELLO DEFORMATO  ##
            pointDef1 = rg.Point3d.Clone( node.get( index1 -1 , "never") )
            pointDef2 = rg.Point3d.Clone( node.get( index2 -1 , "never") )
            pointDef3 = rg.Point3d.Clone( node.get( index3 -1 , "never") )
            pointDef4 = rg.Point3d.Clone( node.get( index4 -1 , "never") )
            pointDef5 = rg.Point3d.Clone( node.get( index5 -1 , "never") )
            pointDef6 = rg.Point3d.Clone( node.get( index6 -1 , "never") )
            pointDef7 = rg.Point3d.Clone( node.get( index7 -1 , "never") )
            pointDef8 = rg.Point3d.Clone( node.get( index8 -1 , "never") )
            vectortrasl1 = rg.Transform.Translation( rg.Vector3d(trasl1.X, trasl1.Y, trasl1.Z)*scaleDef )
            pointDef1.Transform( vectortrasl1 )
            vectortrasl2 = rg.Transform.Translation( rg.Vector3d(trasl2.X, trasl2.Y, trasl2.Z)*scaleDef )
            pointDef2.Transform( vectortrasl2 )
            vectortrasl3 = rg.Transform.Translation( rg.Vector3d(trasl3.X, trasl3.Y, trasl3.Z)*scaleDef )
            pointDef3.Transform( vectortrasl3 )
            vectortrasl4 = rg.Transform.Translation( rg.Vector3d(trasl4.X, trasl4.Y, trasl4.Z)*scaleDef )
            pointDef4.Transform( vectortrasl4 )
            vectortrasl5 = rg.Transform.Translation( rg.Vector3d(trasl5.X, trasl5.Y, trasl5.Z)*scaleDef )
            pointDef5.Transform( vectortrasl1 )
            vectortrasl6 = rg.Transform.Translation( rg.Vector3d(trasl6.X, trasl6.Y, trasl6.Z)*scaleDef )
            pointDef6.Transform( vectortrasl2 )
            vectortrasl7 = rg.Transform.Translation( rg.Vector3d(trasl7.X, trasl7.Y, trasl7.Z)*scaleDef )
            pointDef7.Transform( vectortrasl3 )
            vectortrasl8 = rg.Transform.Translation( rg.Vector3d(trasl8.X, trasl8.Y, trasl8.Z)*scaleDef )
            pointDef8.Transform( vectortrasl4 )
            
            shellDefModel = rg.Mesh()
            shellDefModel.Vertices.Add( pointDef1 ) #0
            shellDefModel.Vertices.Add( pointDef2 ) #1
            shellDefModel.Vertices.Add( pointDef3 ) #2
            shellDefModel.Vertices.Add( pointDef4 ) #3
            shellDefModel.Vertices.Add( pointDef5 ) #4
            shellDefModel.Vertices.Add( pointDef6 ) #5
            shellDefModel.Vertices.Add( pointDef7 ) #6
            shellDefModel.Vertices.Add( pointDef8 ) #7
        
            shellDefModel.Faces.AddFace(0, 1, 2, 3)
            shellDefModel.Faces.AddFace(4, 5, 6, 7)
            shellDefModel.Faces.AddFace(0, 1, 5, 4)
            shellDefModel.Faces.AddFace(1, 2, 6, 5)
            shellDefModel.Faces.AddFace(2, 3, 7, 6)
            shellDefModel.Faces.AddFace(3, 0, 4, 7)
            
            colour = rs.CreateColor( color[0], color[1], color[2] )
            shellDefModel.VertexColors.CreateMonotoneMesh( colour )
            return  [shellDefModel,[trasl1, trasl2, trasl3,trasl4, trasl5, trasl6, trasl7, trasl8 ]]
        
        def defTetraSolid( ele, node, nodeDisp, scaleDef ):
            
            eleTag = ele[0]
            eleNodeTag = ele[1]
            color = ele[2][1]
            #print( eleNodeTag )
            index1 = eleNodeTag[0]
            index2 = eleNodeTag[1]
            index3 = eleNodeTag[2]
            index4 = eleNodeTag[3]
            
            trasl1 = nodeDisp.get( index1 -1 , "never")
            trasl2 = nodeDisp.get( index2 -1 , "never")
            trasl3 = nodeDisp.get( index3 -1 , "never")
            trasl4 = nodeDisp.get( index4 -1 , "never")
            
            ## CREO IL MODELLO DEFORMATO  ##
            pointDef1 = rg.Point3d.Clone( node.get( index1 -1 , "never") )
            pointDef2 = rg.Point3d.Clone( node.get( index2 -1 , "never") )
            pointDef3 = rg.Point3d.Clone( node.get( index3 -1 , "never") )
            pointDef4 = rg.Point3d.Clone( node.get( index4 -1 , "never") )
            
            vectortrasl1 = rg.Transform.Translation( rg.Vector3d(trasl1.X, trasl1.Y, trasl1.Z)*scaleDef )
            pointDef1.Transform( vectortrasl1 )
            vectortrasl2 = rg.Transform.Translation( rg.Vector3d(trasl2.X, trasl2.Y, trasl2.Z)*scaleDef )
            pointDef2.Transform( vectortrasl2 )
            vectortrasl3 = rg.Transform.Translation( rg.Vector3d(trasl3.X, trasl3.Y, trasl3.Z)*scaleDef )
            pointDef3.Transform( vectortrasl3 )
            vectortrasl4 = rg.Transform.Translation( rg.Vector3d(trasl4.X, trasl4.Y, trasl4.Z)*scaleDef )
            pointDef4.Transform( vectortrasl4 )
        
            shellDefModel = rg.Mesh()
            shellDefModel.Vertices.Add( pointDef1 ) #0
            shellDefModel.Vertices.Add( pointDef2 ) #1
            shellDefModel.Vertices.Add( pointDef3 ) #2
            shellDefModel.Vertices.Add( pointDef4 ) #3
            
            
            shellDefModel.Faces.AddFace( 0, 1, 2 )
            shellDefModel.Faces.AddFace( 0, 1, 3 )
            shellDefModel.Faces.AddFace( 1, 2, 3 )
            shellDefModel.Faces.AddFace( 0, 2, 3 )
            colour = rs.CreateColor( color[0], color[1], color[2] )
            shellDefModel.VertexColors.CreateMonotoneMesh( colour )
            
            return  [shellDefModel,[trasl1, trasl2, trasl3, trasl4]]
        ## node e nodeDisp son dictionary ##
        def defValueTimoshenkoBeam( ele, node, nodeDisp, scaleDef ):
            #---------------- WORLD PLANE ----------------------#
            WorldPlane = rg.Plane.WorldXY
            #--------- Propriety TimoshenkoBeam  ----------------#
            TagEle = ele[0]
            propSection = ele[2]
            indexStart = ele[1][0]
            indexEnd = ele[1][1]
            color = propSection[12]
            E = propSection[1]
            G = propSection[2]
            A = propSection[3]
            Avz = propSection[4]
            Avy = propSection[5]
            Jxx = propSection[6]
            Iy = propSection[7]
            Iz = propSection[8]
            #---- traslation and rotation index start & end ------- #
            traslStart = nodeDisp.get( indexStart -1 , "never")[0]
            rotateStart = nodeDisp.get( indexStart -1 , "never")[1]
            traslEnd = nodeDisp.get( indexEnd -1 , "never")[0]
            rotateEnd = nodeDisp.get( indexEnd -1 , "never")[1]
            ##-------------------------------------------- ------------##
            pointStart = node.get( indexStart -1 , "never")
            pointEnd = node.get( indexEnd -1 , "never")
            line = rg.LineCurve( pointStart, pointEnd )
            #-------------------------versor ---------------------------#
            axis1 =  rg.Vector3d( propSection[9][0][0], propSection[9][0][1], propSection[9][0][2]  )
            axis2 =  rg.Vector3d( propSection[9][1][0], propSection[9][1][1], propSection[9][1][2]  )
            axis3 =  rg.Vector3d( propSection[9][2][0], propSection[9][2][1], propSection[9][2][2]  )
            versor = [ axis1, axis2, axis3 ] 
            #---------- WORLD PLANE on point start of line ---------------#
            traslPlane = rg.Transform.Translation( pointStart.X, pointStart.Y, pointStart.Z )
            WorldPlane.Transform( traslPlane )
            #-------------------------------------------------------------#
            planeStart = rg.Plane( pointStart, axis1, axis2 )
            #planeStart = rg.Plane(pointStart, axis3 )
            localPlane = planeStart
            xform = rg.Transform.ChangeBasis( WorldPlane, localPlane )
            localTraslStart = rg.Point3d( traslStart )
            vectorTrasform = rg.Transform.TransformList( xform, [ traslStart, rotateStart, traslEnd, rotateEnd ] )
            #print( vectorTrasform[0] )
            localTraslStart = vectorTrasform[0]
            uI1 = localTraslStart.X # spostamento in direzione dell'asse rosso 
            uI2 = localTraslStart.Y # spostamento in direzione dell'asse verde
            uI3 = localTraslStart.Z # spostamento linea d'asse
            localRotStart = vectorTrasform[1]
            rI1 = localRotStart.X # 
            rI2 = localRotStart.Y # 
            rI3 = localRotStart.Z # 
            localTraslEnd = vectorTrasform[2]
            uJ1 = localTraslEnd.X # spostamento in direzione dell'asse rosso 
            uJ2 = localTraslEnd.Y # spostamento in direzione dell'asse verde
            uJ3 = localTraslEnd.Z # spostamento linea d'asse
            localRotEnd = vectorTrasform[3]
            rJ1 = localRotEnd[0] #  
            rJ2 = localRotEnd[1]  # 
            rJ3 = localRotEnd[2]  # 
            ##------------------ displacement value -------------------------##
            Length = rg.Curve.GetLength( line )
            #divideDistance = 0.5
            segmentCount = Length/0.5
            #print( segmentCount )
            DivCurve = line.DivideByCount( segmentCount, True )
            #DivCurve = line.DivideEquidistant(divideDistance)
            #print( DivCurve )
            if DivCurve == None:
                DivCurve = [ 0, Length]
                
            #s = dg.linspace(0,Length, len(PointsDivLength))
            AlphaY = alphat( E, G, Iy, Avz )
            AlphaZ = alphat( E, G, Iz, Avy )
            
            globalTransVector = []
            globalRotVector = []
            defPoint = []
            defSection = []
            #----------------------- local to global-------------------------#
            xform2 = xform.TryGetInverse()
            #----------------------------------------------------------------#
            for index, x in enumerate(DivCurve):
                beamPoint = line.PointAt(DivCurve[index]) 
                ## SPOSTAMENTO IN DIREZIONE DELL' ASSE 3 ##
                u3 = spostu(x, Length, uI3, uJ3)
                u3Vector = u3*axis3
                ## SPOSTAMENTO IN DIREZIONE DELL' ASSE 1 ##
                v1 =  spostv(x, Length, uI1, uJ1, rI2, rJ2, AlphaY)
                v1Vector = v1*axis1 
                ## SPOSTAMENTO IN DIREZIONE DELL' ASSE 2 ##
                v2 =  spostw(x, Length, uI2, uJ2, rI1, rJ1, AlphaZ)
                v2Vector = v2*axis2 
                
                ## RISULTANTE SPOSTAMENTI ##
                transResult = v1Vector + v2Vector + u3Vector
                
        
                r1x =  psiy(x, Length, uI2, uJ2, rI1, rJ1, AlphaZ)
                r2x =  thetaz(x, Length, uI1, uJ1, rI2, rJ2, AlphaY)
                r3x = phix(x, Length, rI3, rJ3)
                
                rotResult = r1x*axis1 + r2x*axis2 + r3x*axis3
                
                trasl = rg.Transform.Translation( transResult*scaleDef )
                beamPoint.Transform( trasl )
                defPoint.append( beamPoint )
                sectionPlane = rg.Plane( beamPoint, axis1, axis2 )
                sectionPlane.Rotate( scaleDef*r1x, axis1, beamPoint )
                sectionPlane.Rotate( scaleDef*r2x, axis2, beamPoint )
                sectionPlane.Rotate( scaleDef*r3x, axis3, beamPoint )
                if dimSection[0] == 'rectangular' :
                    width, height = dimSection[1], dimSection[2]
                    section = AddRectangleFromCenter( sectionPlane, width, height )
                    defSection.append( section )
                elif dimSection[0] == 'circular' :
                    radius1  = dimSection[1]/2
                    radius2  = dimSection[1]/2 - dimSection[2]
                    section1 = AddCircleFromCenter( sectionPlane, radius1 )
                    if (radius1 - radius2 ) == 0 :
                        defSection.append( section1 )
                    else :
                        section2 = AddCircleFromCenter( sectionPlane, radius2 )
                        defSection.append( [ section1, section2 ] )
                elif dimSection[0] == 'doubleT' :
                    Bsup = dimSection[1]
                    tsup = dimSection[2]
                    Binf = dimSection[3]
                    tinf = dimSection[4]
                    H =  dimSection[5]
                    ta =  dimSection[6]
                    yg =  dimSection[7]
                    section = AddIFromCenter( sectionPlane, Bsup, tsup, Binf, tinf, H, ta, yg )
                    defSection.append( section )
                elif dimSection[0] == 'rectangularHollow' :
                    width, height, thickness = dimSection[1], dimSection[2], dimSection[3]
                    section1 = AddRectangleFromCenter( sectionPlane, width, height )
                    section2 = AddRectangleFromCenter( sectionPlane, width - (2*thickness), height - (2*thickness) )
                    defSection.append( [ section1, section2 ] )
                elif dimSection[0] == 'Generic' :
                    radius  = dimSection[1]
                    section = AddCircleFromCenter( sectionPlane, radius )
                    defSection.append( section )
            
                globalTrasl = rg.Point3d( transResult ) 
                globalTrasl.Transform(xform2[1]) 
                globalTrasl.Transform(xform)
                globalTransVector.append( globalTrasl )
        
           
            defpolyline = rg.PolylineCurve( defPoint )
        
            if dimSection[0] == 'circular' :
                radius1  = dimSection[1]/2
                radius2  = dimSection[1]/2 - dimSection[2]
                if (radius1 - radius2 ) == 0:
                    meshdef = meshLoft3( defSection,  color )
                else :
                    defSection1 = [row[0] for row in defSection ]
                    defSection2 = [row[1] for row in defSection ]
                    meshdef = meshLoft3( defSection1,  color )
                    meshdef.Append( meshLoft3( defSection2,  color ) )
            elif dimSection[0] == 'rectangularHollow' :
                    defSection1 = [row[0] for row in defSection ]
                    defSection2 = [row[1] for row in defSection ]
                    meshdef = meshLoft3( defSection1,  color )
                    meshdef.Append( meshLoft3( defSection2,  color ) )
            else  :
                meshdef = meshLoft3( defSection,  color )
            return  [  defpolyline, meshdef ,  globalTransVector, globalRotVector ] 
        
        ## node e nodeDisp son dictionary ##
        def defTruss( ele, node, nodeDisp, scale ):
            WorldPlane = rg.Plane.WorldXY
            TagEle = ele[0]
            propSection = ele[2]
            color = propSection[12]
            indexStart = ele[1][0]
            indexEnd = ele[1][1]
            E = propSection[1]
            A = propSection[3]
            
            traslStart = nodeDisp.get( indexStart -1 , "never")
            traslEnd = nodeDisp.get( indexEnd -1 , "never")
            if len( traslStart ) == 2:
                traslStart = nodeDisp.get( indexStart -1 , "never")[0]
                traslEnd = nodeDisp.get( indexEnd -1 , "never")[0]
            pointStart = node.get( indexStart -1 , "never")
            pointEnd = node.get( indexEnd -1 , "never")
            #print( traslStart[1] )
            line = rg.LineCurve( pointStart,  pointEnd )
            axis1 =  rg.Vector3d( propSection[9][0][0], propSection[9][0][1], propSection[9][0][2]  )
            axis2 =  rg.Vector3d( propSection[9][1][0], propSection[9][1][1], propSection[9][1][2]  )
            axis3 =  rg.Vector3d( propSection[9][2][0], propSection[9][2][1], propSection[9][2][2]  )
            versor = [ axis1, axis2, axis3 ] 
            #---------- WORLD PLANE on point start of line ---------------#
            traslPlane = rg.Transform.Translation( pointStart.X, pointStart.Y, pointStart.Z )
            WorldPlane.Transform( traslPlane )
            #-------------------------------------------------------------#
            planeStart = rg.Plane(pointStart, axis1, axis2 )
            #planeStart = rg.Plane(pointStart, axis3 )
            localPlane = planeStart
            xform = rg.Transform.ChangeBasis( WorldPlane, localPlane )
            localTraslStart = rg.Point3d( traslStart )
            vectorTrasform = rg.Transform.TransformList( xform, [ traslStart , traslEnd ] )
            #print( vectorTrasform[0] )
            localTraslStart = vectorTrasform[0]
            uI1 = localTraslStart.X # spostamento in direzione dell'asse rosso 
            uI2 = localTraslStart.Y # spostamento in direzione dell'asse verde
            uI3 = localTraslStart.Z # spostamento linea d'asse
            localTraslEnd = vectorTrasform[1]
            uJ1 = localTraslEnd.X # spostamento in direzione dell'asse rosso 
            uJ2 = localTraslEnd.Y # spostamento in direzione dell'asse verde
            uJ3 = localTraslEnd.Z # spostamento linea d'asse
            ##-------------- displacement value -------------------------##
            Length = rg.Curve.GetLength( line )
            #divideDistance = 0.5
            segmentCount = Length/0.5
            #print( segmentCount )
            DivCurve = line.DivideByCount( segmentCount, True )
            #DivCurve = line.DivideEquidistant(divideDistance)
            #print( DivCurve )
            if DivCurve == None:
                DivCurve = [ 0, Length]
            defPoint = []
            defSection = []
            globalTransVector = []
            #----------------------- local to global-------------------------#
            xform2 = xform.TryGetInverse()
            #----------------------------------------------------------------#
            for index, x in enumerate(DivCurve):
                beamPoint = line.PointAt(DivCurve[index]) 
                ## SPOSTAMENTO IN DIREZIONE DELL' ASSE 3 ##
                u3 = spostu(x, Length, uI3, uJ3)
                u3Vector = u3*axis3
                ## SPOSTAMENTO IN DIREZIONE DELL' ASSE 1 ##
                v1 =  x*( uJ1 - uI1 )/Length + uI1
                v1Vector = v1*axis1 
                ## SPOSTAMENTO IN DIREZIONE DELL' ASSE 2 ##
                v2 =  x*( uJ2 - uI2 )/Length + uI2
                v2Vector = v2*axis2 
                ## RISULTANTE SPOSTAMENTI ##
                transResult = v1Vector + v2Vector + u3Vector
                trasl = rg.Transform.Translation( transResult*scale )
                beamPoint.Transform( trasl )
                defPoint.append( beamPoint )
                
                sectionPlane = rg.Plane( beamPoint, axis1, axis2 )
                if dimSection[0] == 'rectangular' :
                    width, height = dimSection[1], dimSection[2]
                    section = AddRectangleFromCenter( sectionPlane, width, height )
                    defSection.append( section )
                elif dimSection[0] == 'circular' :
                    radius1  = dimSection[1]/2
                    radius2  = dimSection[1]/2 - dimSection[2]
                    section1 = AddCircleFromCenter( sectionPlane, radius1 )
                    if (radius1 - radius2 ) == 0 :
                        defSection.append( section1 )
                    else :
                        section2 = AddCircleFromCenter( sectionPlane, radius2 )
                        defSection.append( [ section1, section2 ] )
                elif dimSection[0] == 'doubleT' :
                    Bsup = dimSection[1]
                    tsup = dimSection[2]
                    Binf = dimSection[3]
                    tinf = dimSection[4]
                    H =  dimSection[5]
                    ta =  dimSection[6]
                    yg =  dimSection[7]
                    section = AddIFromCenter( sectionPlane, Bsup, tsup, Binf, tinf, H, ta, yg )
                    defSection.append( section )
                elif dimSection[0] == 'rectangularHollow' :
                    width, height, thickness = dimSection[1], dimSection[2], dimSection[3]
                    section1 = AddRectangleFromCenter( sectionPlane, width, height )
                    section2 = AddRectangleFromCenter( sectionPlane, width - (2*thickness), height - (2*thickness) )
                    defSection.append( [ section1, section2 ] )
                elif dimSection[0] == 'Generic' :
                    radius  = dimSection[1]
                    section = AddCircleFromCenter( sectionPlane, radius )
                    defSection.append( section )
            
                globalTrasl = rg.Point3d( transResult ) 
                globalTrasl.Transform(xform2[1]) 
                globalTrasl.Transform(xform)
                globalTransVector.append( globalTrasl )
        
           
            defpolyline = rg.PolylineCurve( defPoint )
        
            if dimSection[0] == 'circular' :
                radius1  = dimSection[1]/2
                radius2  = dimSection[1]/2 - dimSection[2]
                if (radius1 - radius2 ) == 0:
                    meshdef = meshLoft3( defSection,  color )
                else :
                    defSection1 = [row[0] for row in defSection ]
                    defSection2 = [row[1] for row in defSection ]
                    meshdef = meshLoft3( defSection1,  color )
                    meshdef.Append( meshLoft3( defSection2,  color ) )
            elif dimSection[0] == 'rectangularHollow' :
                    defSection1 = [row[0] for row in defSection ]
                    defSection2 = [row[1] for row in defSection ]
                    meshdef = meshLoft3( defSection1,  color )
                    meshdef.Append( meshLoft3( defSection2,  color ) )
            else  :
                meshdef = meshLoft3( defSection,  color )
        
            return  [ defpolyline, meshdef, globalTransVector]
        
        ## Mesh from close section eith gradient color ##
        def meshLoft3( point, color ):
            #print( point )
            meshEle = rg.Mesh()
            pointSection1 = point
            for i in range(0,len(pointSection1)):
                for j in range(0, len(pointSection1[0])):
                    vertix = pointSection1[i][j]
                    #print( type(vertix) )
                    meshEle.Vertices.Add( vertix ) 
                    #meshEle.VertexColors.Add( color[0],color[1],color[2] );
            k = len(pointSection1[0])
            for i in range(0,len(pointSection1)-1):
                for j in range(0, len(pointSection1[0])):
                    if j < k-1:
                        index1 = i*k + j
                        index2 = (i+1)*k + j
                        index3 = index2 + 1
                        index4 = index1 + 1
                    elif j == k-1:
                        index1 = i*k + j
                        index2 = (i+1)*k + j
                        index3 = (i+1)*k
                        index4 = i*k
                    meshEle.Faces.AddFace(index1, index2, index3, index4)
                    #rs.ObjectColor(scyl,(255,0,0))
            colour = rs.CreateColor( color[0], color[1], color[2] )
            meshEle.VertexColors.CreateMonotoneMesh( colour )
            meshElement = meshEle
            #meshdElement.IsClosed(True)
            
            return meshElement
        
        def gradient(value, valueMin, valueMax, colorList ):
        
            if colorList == [] :
                listcolor = [ rs.CreateColor( 201, 0, 0 ),
                            rs.CreateColor( 240, 69, 7),
                            rs.CreateColor( 251, 255, 0 ),
                            rs.CreateColor( 77, 255, 0 ),
                            rs.CreateColor( 0, 255, 221 ),
                            rs.CreateColor( 0, 81, 255 )]
            else :
                listcolor = colorList
        
            n = len( listcolor )
            domain = linspace( valueMin, valueMax, n)
            #print( domain )
            
            for i in range(1,n+1):
                if  domain[i-1] <= value <= domain[i] :
                    return listcolor[ i-1 ]
                elif  valueMax <= value <= valueMax + 0.0000000000001 :
                    return listcolor[ -1 ]
                elif  valueMin - 0.0000000000001 <= value <= valueMin  :
                    return listcolor[ 0 ]
        
        ## Mesh from close section eith gradient color ##
        def meshLoft4( point, value, valueMax, valueMin ):
            meshEle = rg.Mesh()
            for i in range(0,len(point)):
                color = gradientJet( value[i], valueMax, valueMin )
                for j in range(0, len(point[0])):
                    vertix = point[i][j]
                    meshEle.Vertices.Add( vertix ) 
                    meshEle.VertexColors.Add( color[0],color[1],color[2] );
            k = len(point[0])
            for i in range(0,len(point)-1):
                for j in range(0, len(point[0])):
                    if j < k-1:
                        index1 = i*k + j
                        index2 = (i+1)*k + j
                        index3 = index2 + 1
                        index4 = index1 + 1
                    elif j == k-1:
                        index1 = i*k + j
                        index2 = (i+1)*k + j
                        index3 = (i+1)*k
                        index4 = i*k
                    meshEle.Faces.AddFace(index1, index2, index3, index4)
            return meshEle
        
        
        
        def DeformedModelView(AlpacaStaticOutput, scale, modelExtrud, direction, colorList):
            
            
            global dimSection
            
            direction = 3 if direction is None else direction
            
            diplacementWrapper = AlpacaStaticOutput[0]
            EleOut = AlpacaStaticOutput[2]
            nodeValue = []
            displacementValue = []
            #ShellOut = openSeesOutputWrapper[4]
            
            pointWrapper = []
            dispWrapper = []
            #print( diplacementWrapper )
            for index,item in enumerate(diplacementWrapper):
                nodeValue.append( item[0] )
                displacementValue.append( item[1] )
                pointWrapper.append( [index, rg.Point3d(item[0][0],item[0][1],item[0][2]) ] )
                if len(item[1]) == 3:
                    dispWrapper.append( [index, rg.Point3d( item[1][0], item[1][1], item[1][2] ) ] )
                elif len(item[1]) == 6:
                    dispWrapper.append( [index, [rg.Point3d(item[1][0],item[1][1],item[1][2] ), rg.Point3d(item[1][3],item[1][4],item[1][5]) ] ] )
            
            ## Dict. for point ##
            pointWrapperDict = dict( pointWrapper )
            pointDispWrapperDict = dict( dispWrapper )
            ####
            
            ## FOR scala automatica ##
            ## nodeValue è la lista delle cordinate
            rowX = [row[0] for row in nodeValue ]
            rowY = [row[1] for row in nodeValue ]
            rowZ = [row[2] for row in nodeValue ]
            
            scaleMax = max( max(rowX), max(rowY), max(rowZ) )
            scaleMin = min( min(rowX), min(rowY), min(rowZ) )
            coordMax = max( math.fabs(scaleMin),math.fabs(scaleMax)) - math.fabs(scaleMin)
            
            ## displacementValue è la lista degli spostamenti
            
            rowDefX = [row[0] for row in displacementValue ]
            rowDefY = [row[1] for row in displacementValue ]
            rowDefZ = [row[2] for row in displacementValue ]
            
            defMax = max( max(rowDefX), max(rowDefY), max(rowDefZ) )
            defMin = min( min(rowDefX), min(rowDefY), min(rowDefZ) )
            DefMax = max( math.fabs(defMax),math.fabs(defMin))
            
            if scale == None:
                scaleDef = scaleAutomatic( coordMax , DefMax )
            
            else :
                scaleDef = scale
            
            ExtrudedView = []
            modelDisp = []
            
            modelCurve = []
            traslBeamValue = []
            rotBeamValue = []
            
            ShellDefModel = []
            traslShellValue = []
            rotShellValue = []
            
            SolidDefModel = []
            traslSolidValue = []
            
            
            for ele in EleOut :
                eleType = ele[2][0]
                nNode = len( ele[1] )
                
                if eleType == 'ElasticTimoshenkoBeam' :
                    
                    dimSection = ele[2][10]
                    color = ele[2][12]
                    valueTBeam = defValueTimoshenkoBeam( ele, pointWrapperDict, pointDispWrapperDict, scaleDef )
                    defpolyline = valueTBeam[0]
                    meshdef = valueTBeam[1]
                    globalTrans = valueTBeam[2]
                    globalRot = valueTBeam[3]
                    traslBeamValue.append( globalTrans ) 
                    rotBeamValue.append( globalRot )
                    modelCurve.append( defpolyline )
                    modelDisp.append( defpolyline )
                    # estrusione della beam #
                    ExtrudedView.append( meshdef )
                    #doc.Objects.AddMesh( meshdef )
                elif eleType == 'Truss' :
                    dimSection = ele[2][10]
                    color = ele[2][12]
                    #print( color )
                    valueTruss = defTruss( ele, pointWrapperDict, pointDispWrapperDict, scaleDef )
                    defpolyline = valueTruss[0]
                    meshdef = valueTruss[1]
                    globalTrans = valueTruss[2]
                    traslBeamValue.append( globalTrans ) 
                    modelCurve.append( defpolyline )
                    ExtrudedView.append( meshdef )
                    modelDisp.append( defpolyline )
                    #doc.Objects.AddMesh( meshdef )
            
                elif nNode == 4 and eleType != 'FourNodeTetrahedron':
                    shellDefModel = defShellQuad( ele, pointWrapperDict, pointDispWrapperDict, scaleDef )
                    ShellDefModel.append( shellDefModel[0] )
                    traslShellValue.append( shellDefModel[1] )
                    rotShellValue.append( shellDefModel[2] )
                    extrudeShell = shellDefModel[3]
                    ExtrudedView.append( extrudeShell )
                    #doc.Objects.AddMesh( extrudeShell)
                    
                elif nNode == 3:
                    #print( nNode )
                    shellDefModel = defShellTriangle( ele, pointWrapperDict, pointDispWrapperDict, scaleDef )
                    ShellDefModel.append( shellDefModel[0] )
                    traslShellValue.append( shellDefModel[1] )
                    rotShellValue.append( shellDefModel[2] )
                    extrudeShell = shellDefModel[3]
                    ExtrudedView.append( extrudeShell )
                    #doc.Objects.AddMesh( extrudeShell)
                    
                elif nNode == 8:
                    solidDefModel = defSolid( ele, pointWrapperDict, pointDispWrapperDict, scaleDef)
                    SolidDefModel.append( solidDefModel[0] )
                    #doc.Objects.AddMesh( solidDefModel[0] )
                    traslSolidValue.append( solidDefModel[1] )
                    ExtrudedView.append( solidDefModel[0] )
                    
                elif  eleType == 'FourNodeTetrahedron' :
                    #print(ele)
                    solidDefModel = defTetraSolid( ele, pointWrapperDict, pointDispWrapperDict, scaleDef )
                    SolidDefModel.append( solidDefModel[0] )
                    traslSolidValue.append( solidDefModel[1] )
                    ExtrudedView.append( solidDefModel[0] )
                    
                # MAX an MIN VALOR
            valorVector = []
            # beam valor #
            for valuetrasl in traslBeamValue:
                for valor in valuetrasl:
                    vectorTrasl = rg.Vector3d( valor )
                    if direction == 0:
                        valorVector.append( vectorTrasl.X ) 
                    elif direction == 1:
                        valorVector.append( vectorTrasl.Y )
                    elif direction == 2:
                        valorVector.append( vectorTrasl.Z ) 
                    elif direction == 3:
                        valorVector.append( vectorTrasl.Length )     
            # POINT #
            if len(dispWrapper[0][1]) == 3 :
                PointDisp = [row[1] for row in dispWrapper ] 
            else:
                PointDisp = [row[1][0] for row in dispWrapper ]
            
            for nodeDisp in PointDisp :
                vectorNodeDisp = rg.Vector3d( nodeDisp )
                if direction == 0:
                    valorVector.append( vectorNodeDisp.X ) 
                elif direction == 1:
                    valorVector.append( vectorNodeDisp.Y )
                elif direction == 2:
                    valorVector.append( vectorNodeDisp.Z ) 
                elif direction == 3:
                    valorVector.append( vectorNodeDisp.Length )
            # MAX end MIN on structures point #
            lowerLimit = min( valorVector )
            upperLimit = max( valorVector )
            domainValues = [ lowerLimit, upperLimit ]
            #print( lowerLimit, upperLimit )
            #####################################################################################
            colorBeam = []
            numberDivide = []
            for value in traslBeamValue :
                colorValor = []
                for valor in value:
                    vectorTrasl = rg.Vector3d( valor )
            
                    if direction == 0:
                        valorVector = vectorTrasl.X  
                    elif direction == 1:
                        valorVector = vectorTrasl.Y 
                    elif direction == 2:
                        valorVector = vectorTrasl.Z  
                    elif direction == 3:
                        valorVector = vectorTrasl.Length
            
                    color = gradient( valorVector, lowerLimit, upperLimit, colorList )
                    colorValor.append( color )
                colorBeam.append( colorValor )
                numberDivide.append( len(colorValor) )
            segment = []
            for curve, segmentCount in zip( modelCurve, numberDivide ):
                parameter = curve.DivideByCount( segmentCount - 1, True )
                segmentCurve = []
                for i in range(1, len(parameter)) :
                        p1 =  rg.Curve.PointAt( curve, parameter[i-1] ) 
                        p2 = rg.Curve.PointAt( curve, parameter[i] )
                        segmentCurve.append( rg.Line( p1, p2 ) )
                segment.append( segmentCurve )
            
            
            for shellEle, value in zip(ShellDefModel,traslShellValue) :
                shellColor = shellEle.DuplicateMesh()
                shellColor.VertexColors.Clear()
                for j in range( 0,shellEle.Vertices.Count ):
                    vectorTrasl = rg.Vector3d( value[j] )
                    if direction == 0:
                        valorVector = vectorTrasl.X  
                    elif direction == 1:
                        valorVector = vectorTrasl.Y 
                    elif direction == 2:
                        valorVector = vectorTrasl.Z  
                    elif direction == 3:
                        valorVector = vectorTrasl.Length
            
                    color = gradient( valorVector, lowerLimit, upperLimit, colorList )
                    shellColor.VertexColors.Add( color )
                modelDisp.append( shellColor)
             #dup.VertexColors.CreateMonotoneMesh(Color.Red)
            #doc.Objects.AddMesh(dup)
            for solidEle, value in zip(SolidDefModel,traslSolidValue) :
                solidColor = solidEle.DuplicateMesh()
                solidColor.VertexColors.Clear()
                for j in range(0,solidEle.Vertices.Count):
                    vectorTrasl = rg.Vector3d( value[j] )
                    if direction == 0:
                        valorVector = vectorTrasl.X  
                    elif direction == 1:
                        valorVector = vectorTrasl.Y 
                    elif direction == 2:
                        valorVector = vectorTrasl.Z  
                    elif direction == 3:
                        valorVector = vectorTrasl.Length
            
                    color = gradient( valorVector, lowerLimit, upperLimit, colorList )
                    solidColor.VertexColors.Add( color )
                modelDisp.append( solidColor )
                
            if modelExtrud == False or modelExtrud == None:
                self.line = segment
                self.colorLine = colorBeam
                return modelDisp, domainValues
            else:
                self.line = []
                self.colorLine = []
                return ExtrudedView, domainValues


        
        checkData = True
        
        if not AlpacaStaticOutput:
            checkData = False
            msg = "input 'AlpacaStaticOutput' failed to collect data"  
            ghenv.Component.AddRuntimeMessage(gh.Kernel.GH_RuntimeMessageLevel.Warning, msg)
        
        if checkData != False:
            modelDisp, domainValues = DeformedModelView(AlpacaStaticOutput, scale, modelExtrud, direction, colorList)
            return (modelDisp, domainValues)


    def DrawViewportWires(self,arg):
        
        for crvs, colors in zip(self.line, self.colorLine):
            for crv, color in zip(crvs, colors):
                arg.Display.DrawLine(crv, color, 4)
# ---------- end ghpython_script_44 ----------
panel_36 = Panel(merge_6)  # disabled
# displacement Component
cluster_3 = Cluster(gate=0)  # disabled

quick_graph_4 = QuickGraph(data_recorder, SortOrder=0)  # disabled
quick_graph_5 = QuickGraph(data_recorder_2, SortOrder=0)  # disabled
vector_length_2 = VectorLength(Vector=vector_8)  # disabled
alpaca = Panel(ghpython_script_37.M2)
data_22 = Data([data_21, number_slider_26, boolean_toggle_9, value_list_14])
karamba = Panel(beam_forces_karamba3d.BendingMomentMy_kNm)
geometry_6 = Geometry(ghpython_script_44.modelDisp)
# ---- group: MODAL ANALYSIS
ghpython_script_45 = GhPythonScript(
    AlpacaModalOutput=analyze_5.AlpacaModalOutput,
    numberMode=number_slider_20,
    speed=Slider(1, range=1..50),
    Animate=Toggle(False),
    Reset=Button(),
    modelExtrude=Toggle(False))  # -> modelDisp; inputs AlpacaModalOutput: list, numberMode: Int32, speed: Int32, Animate: Boolean, Reset: Boolean, direction: Int32, modelExtrude: Boolean, colorList: list of Color
# ---------- ghpython_script_45: Python ----------
"""Visualize the Modal Shapes
    Inputs:
        AlpacaModalOutput: Analysed Alpaca Model.
        numberMode: number of mode to visualize.
        speed: 
        Animate: True - Animate the model.
        Reset:
        scale: Factor to multiply the modal shapes.
        direction : view relative color of the traslation:
            '0' view traslation X.
            '1' view traslation Y.
            '2' view traslation Z.
            '3' view resulting displacement.
        modelExtrude: True - view extruded model.
        colorList: optional color list to remap number to colors.
    Output:
        ModelDisp: Deformed model for the selected modal shape.
"""

from ghpythonlib.componentbase import executingcomponent as component
import Grasshopper, GhPython
import System
import Rhino
import rhinoscriptsyntax as rs

class MyComponent(component):
    
    def RunScript(self, AlpacaModalOutput, numberMode, speed, Animate, Reset, scale, direction, modelExtrude, colorList):
        import Rhino as rc
        import Rhino.Geometry as rg
        import math as mt
        import ghpythonlib.treehelpers as th # per data tree
        import Grasshopper as gh
        import sys
        import rhinoscriptsyntax as rs
        import Rhino.Display as rd
        from scriptcontext import sticky as st
        import System.Drawing.Color
        import scriptcontext as sc
        #----------------------------------------------------------------------#
                
        def alphat( E, G, I, At ):
            return (E*I)/(G*At)
    
        ## Spostamenti e rotazioni ##
        def spostu( x, L, uI, uJ ):
            return -(-L*uI + uI*x - uJ*x)/L
            
        def spostv( x, L, vI, vJ, thetaI, thetaJ, alphay ):
            return (L**3*thetaI*x + L**3*vI - 2*L**2*thetaI*x**2 - L**2*thetaJ*x**2 + 6*L*alphay*thetaI*x - 6*L*alphay*thetaJ*x + 12*L*alphay*vI + L*thetaI*x**3 + L*thetaJ*x**3 - 3*L*vI*x**2 + 3*L*vJ*x**2 - 6*alphay*thetaI*x**2 + 6*alphay*thetaJ*x**2 - 12*alphay*vI*x + 12*alphay*vJ*x + 2*vI*x**3 - 2*vJ*x**3)/(L*(L**2 + 12*alphay))
            
        def spostw( x, L, wI, wJ, psiI, psiJ, alphaz ):
            return -(L**3*psiI*x - L**3*wI - 2*L**2*psiI*x**2 - L**2*psiJ*x**2 - 6*L*alphaz*psiI*x + 6*L*alphaz*psiJ*x + 12*L*alphaz*wI + L*psiI*x**3 + L*psiJ*x**3 + 3*L*wI*x**2 - 3*L*wJ*x**2 + 6*alphaz*psiI*x**2 - 6*alphaz*psiJ*x**2 - 12*alphaz*wI*x + 12*alphaz*wJ*x - 2*wI*x**3 + 2*wJ*x**3)/(L*(L**2 - 12*alphaz))
            
        def thetaz(x, L, vI, vJ, thetaI, thetaJ, alphay): 
            return (L**3*thetaI - 4*L**2*thetaI*x - 2*L**2*thetaJ*x + 12*L*alphay*thetaI + 3*L*thetaI*x**2 + 3*L*thetaJ*x**2 - 6*L*vI*x + 6*L*vJ*x - 12*alphay*thetaI*x + 12*alphay*thetaJ*x + 6*vI*x**2 - 6*vJ*x**2)/(L*(L**2 + 12*alphay))
            
        def phix(x, L, phiI, phiJ):
            return -(-L*phiI + phiI*x - phiJ*x)/L
    
        def psiy(x, L, wI, wJ, psiI, psiJ, alphaz): 
            return (L**3*psiI - 4*L**2*psiI*x - 2*L**2*psiJ*x - 12*L*alphaz*psiI + 3*L*psiI*x**2 + 3*L*psiJ*x**2 + 6*L*wI*x - 6*L*wJ*x + 12*alphaz*psiI*x - 12*alphaz*psiJ*x - 6*wI*x**2 + 6*wJ*x**2)/(L*(L**2 - 12*alphaz))
            
        def gammay( L, vI, vJ, thetaI, thetaJ, alphay): 
    
            return (L*thetaI + L*thetaJ + 2*vI - 2*vJ)/(L*(L**2 + 12*alphay))
            
        def gammaz( L, wI, wJ, psiI, psiJ, alphaz):
    
            return -(L*psiI + L*psiJ - 2*wI + 2*wJ)/(L*(L**2 - 12*alphaz))
    
        ##------------------------------------------------------------------------- --##
    
        def scaleAutomatic( Num , Den ):
            if Den < 0.1 :
                return Num
            else :
                return Num*1/Den
    
        def linspace(a, b, n=100):
            if n < 2:
                return b
            diff = (float(b) - a)/(n - 1)
            return [diff * i + a  for i in range(n)]
    
        ## Funzione rettangolo ##
        def AddRectangleFromCenter(plane, width, height):
            a = plane.PointAt(-width * 0.5, -height * 0.5 )
            b = plane.PointAt(-width * 0.5,  height * 0.5 )
            c = plane.PointAt( width * 0.5,  height * 0.5 )
            d = plane.PointAt( width * 0.5,  -height * 0.5 )
            #rectangle = rg.PolylineCurve( [a, b, c, d, a] )
            rectangle  = [a, b, c, d] 
            return rectangle
            
        ## Funzione cerchio ##
        def AddCircleFromCenter( plane, radius):
            t = linspace( 0 , 1.80*mt.pi, 15 )
            a = []
            for ti in t:
                x = radius*mt.cos(ti)
                y = radius*mt.sin(ti)
                a.append( plane.PointAt( x, y ) )
            #circle = rg.PolylineCurve( a )
            circle  = a 
            return circle
    
        def AddIFromCenter(plane, Bsup, tsup, Binf, tinf, H, ta, yg):
    
            p1 = plane.PointAt( -(yg - tinf), ta/2 )
            p2 = plane.PointAt( -(yg - tinf), Binf/2 )
            p3 = plane.PointAt( -yg, Binf/2 )
            p4 = plane.PointAt( -yg, -Binf/2 )
            p5 = plane.PointAt( -(yg - tinf), -Binf/2 ) 
            p6 = plane.PointAt( -(yg - tinf), -ta/2 )
            p7 = plane.PointAt( (H - yg - tsup), -ta/2)
            p8 = plane.PointAt( (H - yg - tsup), -Bsup/2 )
            p9 = plane.PointAt( (H - yg ), -Bsup/2 )
            p10 = plane.PointAt( (H - yg ), Bsup/2 )
            p11 = plane.PointAt( (H - yg - tsup), Bsup/2 )
            p12 = plane.PointAt( (H - yg - tsup), ta/2 )
    
            wirframe  = [ p1, p2, p3, p4, p5, p6, p7, p8, p9, p10, p11, p12 ] 
            return wirframe
            
        def defShellQuad( ele, node, nodeDisp, scaleDef ):
            
            eleTag = ele[0]
            eleNodeTag = ele[1]
            color = ele[2][2]
            thick = ele[2][1]
            index1 = eleNodeTag[0]
            index2 = eleNodeTag[1]
            index3 = eleNodeTag[2]
            index4 = eleNodeTag[3]
            
            trasl1 = nodeDisp.get( index1 -1 , "never")[0]
            rotate1 = nodeDisp.get( index1 -1 , "never")[1]
            
            trasl2 = nodeDisp.get( index2 -1 , "never")[0]
            rotate2 = nodeDisp.get( index2 -1 , "never")[1]
            
            trasl3 = nodeDisp.get( index3 -1 , "never")[0]
            rotate3 = nodeDisp.get( index3 -1 , "never")[1]
            
            trasl4 = nodeDisp.get( index4 -1 , "never")[0]
            rotate4 = nodeDisp.get( index4 -1 , "never")[1]
            
            ## CREO IL MODELLO DEFORMATO  ##
            
            pointDef1 = rg.Vector3d.Clone( node.get( index1 -1 , "never") )
            pointDef2 = rg.Vector3d.Clone( node.get( index2 -1 , "never") )
            pointDef3 = rg.Vector3d.Clone( node.get( index3 -1 , "never") )
            pointDef4 = rg.Vector3d.Clone( node.get( index4 -1 , "never") )
            vectortrasl1 = rg.Transform.Translation( rg.Vector3d(trasl1.X, trasl1.Y, trasl1.Z)*scaleDef )
            pointDef1.Transform( vectortrasl1 )
            vectortrasl2 = rg.Transform.Translation( rg.Vector3d(trasl2.X, trasl2.Y, trasl2.Z)*scaleDef )
            pointDef2.Transform( vectortrasl2 )
            vectortrasl3 = rg.Transform.Translation( rg.Vector3d(trasl3.X, trasl3.Y, trasl3.Z)*scaleDef )
            pointDef3.Transform( vectortrasl3 )
            vectortrasl4 = rg.Transform.Translation( rg.Vector3d(trasl4.X, trasl4.Y, trasl4.Z)*scaleDef )
            pointDef4.Transform( vectortrasl4 )
            shellDefModel = rg.Mesh()
            shellDefModel.Vertices.Add( pointDef1 ) #0
            shellDefModel.Vertices.Add( pointDef2 ) #1
            shellDefModel.Vertices.Add( pointDef3 ) #2
            shellDefModel.Vertices.Add( pointDef4 ) #3
            
            
            shellDefModel.Faces.AddFace(0, 1, 2, 3)
            colour = rs.CreateColor( color[0], color[1], color[2] )
            shellDefModel.VertexColors.CreateMonotoneMesh( colour )
    
            vt = shellDefModel.Vertices
            shellDefModel.FaceNormals.ComputeFaceNormals()
            fid,MPt = shellDefModel.ClosestPoint(vt[0],0.01)
            normalFace = shellDefModel.FaceNormals[fid]
            vectormoltiplicate = rg.Vector3d.Multiply( -normalFace, thick/2 )
            trasl = rg.Transform.Translation( vectormoltiplicate )
            moveShell = rg.Mesh.DuplicateMesh(shellDefModel)
            moveShell.Transform( trasl )
            extrudeShell = rg.Mesh.Offset( moveShell, thick, True, normalFace)
            return  [shellDefModel,[trasl1, trasl2, trasl3, trasl4], [rotate1, rotate2, rotate3, rotate4], extrudeShell ]
    
        def defShellTriangle( ele, node, nodeDisp, scaleDef ):
            
            eleTag = ele[0]
            eleNodeTag = ele[1]
            color = ele[2][2]
            thick = ele[2][1]
            
            index1 = eleNodeTag[0]
            index2 = eleNodeTag[1]
            index3 = eleNodeTag[2]
            
            trasl1 = nodeDisp.get( index1 -1 , "never")[0]
            rotate1 = nodeDisp.get( index1 -1 , "never")[1]
            
            trasl2 = nodeDisp.get( index2 -1 , "never")[0]
            rotate2 = nodeDisp.get( index2 -1 , "never")[1]
            
            trasl3 = nodeDisp.get( index3 -1 , "never")[0]
            rotate3 = nodeDisp.get( index3 -1 , "never")[1]
            
            ## CREO IL MODELLO DEFORMATO  ##
            pointDef1 = rg.Point3d.Clone( node.get( index1 -1 , "never") )
            pointDef2 = rg.Point3d.Clone( node.get( index2 -1 , "never") )
            pointDef3 = rg.Point3d.Clone( node.get( index3 -1 , "never") )
            vectortrasl1 = rg.Transform.Translation( rg.Vector3d(trasl1.X, trasl1.Y, trasl1.Z)*scaleDef )
            pointDef1.Transform( vectortrasl1 )
            vectortrasl2 = rg.Transform.Translation( rg.Vector3d(trasl2.X, trasl2.Y, trasl2.Z)*scaleDef )
            pointDef2.Transform( vectortrasl2 )
            vectortrasl3 = rg.Transform.Translation( rg.Vector3d(trasl3.X, trasl3.Y, trasl3.Z)*scaleDef )
            pointDef3.Transform( vectortrasl3 )
            shellDefModel = rg.Mesh()
            shellDefModel.Vertices.Add( pointDef1 ) #0
            shellDefModel.Vertices.Add( pointDef2 ) #1
            shellDefModel.Vertices.Add( pointDef3 ) #2
            
            shellDefModel.Faces.AddFace(0, 1, 2)
            colour = rs.CreateColor( color[0], color[1], color[2] )
            vt = shellDefModel.Vertices
            shellDefModel.FaceNormals.ComputeFaceNormals()
            fid,MPt = shellDefModel.ClosestPoint(vt[0],0.01)
            normalFace = shellDefModel.FaceNormals[fid]
            vectormoltiplicate = rg.Vector3d.Multiply( -normalFace, thick/2 )
            trasl = rg.Transform.Translation( vectormoltiplicate )
            moveShell = rg.Mesh.DuplicateMesh(shellDefModel)
            moveShell.Transform( trasl )
            extrudeShell = rg.Mesh.Offset( moveShell, thick, True, normalFace)
            return  [shellDefModel,[trasl1, trasl2, trasl3], [rotate1, rotate2, rotate3], extrudeShell ]
    
        def defSolid( ele, node, nodeDisp, scaleDef ):
            
            eleTag = ele[0]
            eleNodeTag = ele[1]
            color = ele[2][1]
            thick = ele[2][1]
            #print( eleNodeTag )
            index1 = eleNodeTag[0]
            index2 = eleNodeTag[1]
            index3 = eleNodeTag[2]
            index4 = eleNodeTag[3]
            index5 = eleNodeTag[4]
            index6 = eleNodeTag[5]
            index7 = eleNodeTag[6]
            index8 = eleNodeTag[7]
            
            trasl1 = nodeDisp.get( index1 -1 , "never")
            trasl2 = nodeDisp.get( index2 -1 , "never")
            trasl3 = nodeDisp.get( index3 -1 , "never")
            trasl4 = nodeDisp.get( index4 -1 , "never")
            trasl5 = nodeDisp.get( index5 -1 , "never")
            trasl6 = nodeDisp.get( index6 -1 , "never")
            trasl7 = nodeDisp.get( index7 -1 , "never")
            trasl8 = nodeDisp.get( index8 -1 , "never")
            
            ## CREO IL MODELLO DEFORMATO  ##
            pointDef1 = rg.Point3d.Clone( node.get( index1 -1 , "never") )
            pointDef2 = rg.Point3d.Clone( node.get( index2 -1 , "never") )
            pointDef3 = rg.Point3d.Clone( node.get( index3 -1 , "never") )
            pointDef4 = rg.Point3d.Clone( node.get( index4 -1 , "never") )
            pointDef5 = rg.Point3d.Clone( node.get( index5 -1 , "never") )
            pointDef6 = rg.Point3d.Clone( node.get( index6 -1 , "never") )
            pointDef7 = rg.Point3d.Clone( node.get( index7 -1 , "never") )
            pointDef8 = rg.Point3d.Clone( node.get( index8 -1 , "never") )
            vectortrasl1 = rg.Transform.Translation( rg.Vector3d(trasl1.X, trasl1.Y, trasl1.Z)*scaleDef )
            pointDef1.Transform( vectortrasl1 )
            vectortrasl2 = rg.Transform.Translation( rg.Vector3d(trasl2.X, trasl2.Y, trasl2.Z)*scaleDef )
            pointDef2.Transform( vectortrasl2 )
            vectortrasl3 = rg.Transform.Translation( rg.Vector3d(trasl3.X, trasl3.Y, trasl3.Z)*scaleDef )
            pointDef3.Transform( vectortrasl3 )
            vectortrasl4 = rg.Transform.Translation( rg.Vector3d(trasl4.X, trasl4.Y, trasl4.Z)*scaleDef )
            pointDef4.Transform( vectortrasl4 )
            vectortrasl5 = rg.Transform.Translation( rg.Vector3d(trasl5.X, trasl5.Y, trasl5.Z)*scaleDef )
            pointDef5.Transform( vectortrasl1 )
            vectortrasl6 = rg.Transform.Translation( rg.Vector3d(trasl6.X, trasl6.Y, trasl6.Z)*scaleDef )
            pointDef6.Transform( vectortrasl2 )
            vectortrasl7 = rg.Transform.Translation( rg.Vector3d(trasl7.X, trasl7.Y, trasl7.Z)*scaleDef )
            pointDef7.Transform( vectortrasl3 )
            vectortrasl8 = rg.Transform.Translation( rg.Vector3d(trasl8.X, trasl8.Y, trasl8.Z)*scaleDef )
            pointDef8.Transform( vectortrasl4 )
            
            shellDefModel = rg.Mesh()
            shellDefModel.Vertices.Add( pointDef1 ) #0
            shellDefModel.Vertices.Add( pointDef2 ) #1
            shellDefModel.Vertices.Add( pointDef3 ) #2
            shellDefModel.Vertices.Add( pointDef4 ) #3
            shellDefModel.Vertices.Add( pointDef5 ) #4
            shellDefModel.Vertices.Add( pointDef6 ) #5
            shellDefModel.Vertices.Add( pointDef7 ) #6
            shellDefModel.Vertices.Add( pointDef8 ) #7
    
            shellDefModel.Faces.AddFace(0, 1, 2, 3)
            shellDefModel.Faces.AddFace(4, 5, 6, 7)
            shellDefModel.Faces.AddFace(0, 1, 5, 4)
            shellDefModel.Faces.AddFace(1, 2, 6, 5)
            shellDefModel.Faces.AddFace(2, 3, 7, 6)
            shellDefModel.Faces.AddFace(3, 0, 4, 7)
            
            colour = rs.CreateColor( color[0], color[1], color[2] )
            shellDefModel.VertexColors.CreateMonotoneMesh( colour )
            return  [shellDefModel,[trasl1, trasl2, trasl3,trasl4, trasl5, trasl6, trasl7, trasl8 ]]
    
        def defTetraSolid( ele, node, nodeDisp, scaleDef ):
            
            eleTag = ele[0]
            eleNodeTag = ele[1]
            color = ele[2][1]
            #print( eleNodeTag )
            index1 = eleNodeTag[0]
            index2 = eleNodeTag[1]
            index3 = eleNodeTag[2]
            index4 = eleNodeTag[3]
            
            trasl1 = nodeDisp.get( index1 -1 , "never")
            trasl2 = nodeDisp.get( index2 -1 , "never")
            trasl3 = nodeDisp.get( index3 -1 , "never")
            trasl4 = nodeDisp.get( index4 -1 , "never")
            
            ## CREO IL MODELLO DEFORMATO  ##
            pointDef1 = rg.Point3d.Clone( node.get( index1 -1 , "never") )
            pointDef2 = rg.Point3d.Clone( node.get( index2 -1 , "never") )
            pointDef3 = rg.Point3d.Clone( node.get( index3 -1 , "never") )
            pointDef4 = rg.Point3d.Clone( node.get( index4 -1 , "never") )
            
            vectortrasl1 = rg.Transform.Translation( rg.Vector3d(trasl1.X, trasl1.Y, trasl1.Z)*scaleDef )
            pointDef1.Transform( vectortrasl1 )
            vectortrasl2 = rg.Transform.Translation( rg.Vector3d(trasl2.X, trasl2.Y, trasl2.Z)*scaleDef )
            pointDef2.Transform( vectortrasl2 )
            vectortrasl3 = rg.Transform.Translation( rg.Vector3d(trasl3.X, trasl3.Y, trasl3.Z)*scaleDef )
            pointDef3.Transform( vectortrasl3 )
            vectortrasl4 = rg.Transform.Translation( rg.Vector3d(trasl4.X, trasl4.Y, trasl4.Z)*scaleDef )
            pointDef4.Transform( vectortrasl4 )
    
            shellDefModel = rg.Mesh()
            shellDefModel.Vertices.Add( pointDef1 ) #0
            shellDefModel.Vertices.Add( pointDef2 ) #1
            shellDefModel.Vertices.Add( pointDef3 ) #2
            shellDefModel.Vertices.Add( pointDef4 ) #3
            
            
            shellDefModel.Faces.AddFace( 0, 1, 2 )
            shellDefModel.Faces.AddFace( 0, 1, 3 )
            shellDefModel.Faces.AddFace( 1, 2, 3 )
            shellDefModel.Faces.AddFace( 0, 2, 3 )
            colour = rs.CreateColor( color[0], color[1], color[2] )
            shellDefModel.VertexColors.CreateMonotoneMesh( colour )
            
            return  [shellDefModel,[trasl1, trasl2, trasl3, trasl4]]
        ## node e nodeDisp son dictionary ##
        def defValueTimoshenkoBeam( ele, node, nodeDisp, scaleDef ):
            #---------------- WORLD PLANE ----------------------#
            WorldPlane = rg.Plane.WorldXY
            #--------- Propriety TimoshenkoBeam  ----------------#
            TagEle = ele[0]
            propSection = ele[2]
            indexStart = ele[1][0]
            indexEnd = ele[1][1]
            color = propSection[12]
            E = propSection[1]
            G = propSection[2]
            A = propSection[3]
            Avz = propSection[4]
            Avy = propSection[5]
            Jxx = propSection[6]
            Iy = propSection[7]
            Iz = propSection[8]
            #---- traslation and rotation index start & end ------- #
            traslStart = nodeDisp.get( indexStart -1 , "never")[0]
            rotateStart = nodeDisp.get( indexStart -1 , "never")[1]
            traslEnd = nodeDisp.get( indexEnd -1 , "never")[0]
            rotateEnd = nodeDisp.get( indexEnd -1 , "never")[1]
            ##-------------------------------------------- ------------##
            pointStart = node.get( indexStart -1 , "never")
            pointEnd = node.get( indexEnd -1 , "never")
            line = rg.LineCurve( pointStart, pointEnd )
            #-------------------------versor ---------------------------#
            axis1 =  rg.Vector3d( propSection[9][0][0], propSection[9][0][1], propSection[9][0][2]  )
            axis2 =  rg.Vector3d( propSection[9][1][0], propSection[9][1][1], propSection[9][1][2]  )
            axis3 =  rg.Vector3d( propSection[9][2][0], propSection[9][2][1], propSection[9][2][2]  )
            versor = [ axis1, axis2, axis3 ] 
            #---------- WORLD PLANE on point start of line ---------------#
            traslPlane = rg.Transform.Translation( pointStart.X, pointStart.Y, pointStart.Z )
            WorldPlane.Transform( traslPlane )
            #-------------------------------------------------------------#
            planeStart = rg.Plane(pointStart, axis1, axis2 )
            #planeStart = rg.Plane(pointStart, axis3 )
            localPlane = planeStart
            xform = rg.Transform.ChangeBasis( WorldPlane, localPlane )
            localTraslStart = rg.Vector3d( traslStart )
            vectorTrasform = rg.Transform.TransformList( xform, [ traslStart, rotateStart, traslEnd, rotateEnd ] )
            #print( vectorTrasform[0] )
            localTraslStart = vectorTrasform[0]
            uI1 = localTraslStart.X # spostamento in direzione dell'asse rosso 
            uI2 = localTraslStart.Y # spostamento in direzione dell'asse verde
            uI3 = localTraslStart.Z # spostamento linea d'asse
            localRotStart = vectorTrasform[1]
            rI1 = localRotStart.X # 
            rI2 = localRotStart.Y # 
            rI3 = localRotStart.Z # 
            localTraslEnd = vectorTrasform[2]
            uJ1 = localTraslEnd.X # spostamento in direzione dell'asse rosso 
            uJ2 = localTraslEnd.Y # spostamento in direzione dell'asse verde
            uJ3 = localTraslEnd.Z # spostamento linea d'asse
            localRotEnd = vectorTrasform[3]
            rJ1 = localRotEnd[0] #  
            rJ2 = localRotEnd[1]  # 
            rJ3 = localRotEnd[2]  # 
            ##------------------ displacement value -------------------------##
            Length = rg.Curve.GetLength( line )
            segmentCount = Length/0.5
            DivCurve = line.DivideByCount( segmentCount, True )
            if DivCurve == None:
                DivCurve = [ 0, Length]
                
            #s = dg.linspace(0,Length, len(PointsDivLength))
            AlphaY = alphat( E, G, Iy, Avz )
            AlphaZ = alphat( E, G, Iz, Avy )
            
            globalTransVector = []
            globalRotVector = []
            defPoint = []
            defSection = []
            #----------------------- local to global-------------------------#
            xform2 = xform.TryGetInverse()
            #----------------------------------------------------------------#
            for index, x in enumerate(DivCurve):
                beamPoint = line.PointAt(DivCurve[index]) 
                ## SPOSTAMENTO IN DIREZIONE DELL' ASSE 3 ##
                u3 = spostu(x, Length, uI3, uJ3)
                u3Vector = u3*axis3
                ## SPOSTAMENTO IN DIREZIONE DELL' ASSE 1 ##
                v1 =  spostv(x, Length, uI1, uJ1, rI2, rJ2, AlphaY)
                v1Vector = v1*axis1 
                ## SPOSTAMENTO IN DIREZIONE DELL' ASSE 2 ##
                v2 =  spostw(x, Length, uI2, uJ2, rI1, rJ1, AlphaZ)
                v2Vector = v2*axis2 
                
                ## RISULTANTE SPOSTAMENTI ##
                transResult = v1Vector + v2Vector + u3Vector
                
                r2x =  thetaz(x, Length, uI1, uJ1, rI2, rJ2, AlphaY)
                r1x =  psiy(x, Length, uI2, uJ2, rI1, rJ1, AlphaZ)
                r3x = phix(x, Length, rI3, rJ3)
                
                rotResult = r1x*axis1 + r2x*axis2 + r3x*axis3
                
                trasl = rg.Transform.Translation( transResult*scaleDef )
                beamPoint.Transform( trasl )
                defPoint.append( beamPoint )
                
                sectionPlane = rg.Plane( beamPoint, axis1, axis2 )
                sectionPlane.Rotate( scaleDef*r1x, axis1, beamPoint )
                sectionPlane.Rotate( scaleDef*r2x, axis2, beamPoint )
                sectionPlane.Rotate( scaleDef*r3x, axis3, beamPoint )
                if dimSection[0] == 'rectangular' :
                    width, height = dimSection[1], dimSection[2]
                    section = AddRectangleFromCenter( sectionPlane, width, height )
                    defSection.append( section )
                elif dimSection[0] == 'circular' :
                    radius1  = dimSection[1]/2
                    radius2  = dimSection[1]/2 - dimSection[2]
                    section1 = AddCircleFromCenter( sectionPlane, radius1 )
                    if (radius1 - radius2 ) == 0 :
                        defSection.append( section1 )
                    else :
                        section2 = AddCircleFromCenter( sectionPlane, radius2 )
                        defSection.append( [ section1, section2 ] )
                elif dimSection[0] == 'doubleT' :
                    Bsup = dimSection[1]
                    tsup = dimSection[2]
                    Binf = dimSection[3]
                    tinf = dimSection[4]
                    H =  dimSection[5]
                    ta =  dimSection[6]
                    yg =  dimSection[7]
                    section = AddIFromCenter( sectionPlane, Bsup, tsup, Binf, tinf, H, ta, yg )
                    defSection.append( section )
                elif dimSection[0] == 'Generic' :
                    radius  = dimSection[1]
                    section = AddCircleFromCenter( sectionPlane, radius )
                    defSection.append( section )
            
                globalTrasl = rg.Vector3d( transResult ) 
                globalTrasl.Transform(xform2[1]) 
                globalTrasl.Transform(xform)
                globalTransVector.append( globalTrasl )
    
           
            defpolyline = rg.PolylineCurve( defPoint )
    
            if dimSection[0] == 'circular' :
                radius1  = dimSection[1]/2
                radius2  = dimSection[1]/2 - dimSection[2]
                if (radius1 - radius2 ) == 0:
                    meshdef = meshLoft3( defSection,  color )
    
                else :
                    defSection1 = [row[0] for row in defSection ]
                    defSection2 = [row[1] for row in defSection ]
                    meshdef = meshLoft3( defSection1,  color )
                    meshdef.Append( meshLoft3( defSection2,  color ) )
                    print( meshdef )
    
            else  :
                meshdef = meshLoft3( defSection,  color )
            return  [  defpolyline, meshdef ,  globalTransVector, globalRotVector ] 
    
        ## node e nodeDisp son dictionary ##
        def defTruss( ele, node, nodeDisp, scale ):
            WorldPlane = rg.Plane.WorldXY
            TagEle = ele[0]
            propSection = ele[2]
            color = propSection[12]
            indexStart = ele[1][0]
            indexEnd = ele[1][1]
            E = propSection[1]
            A = propSection[3]
            
            traslStart = nodeDisp.get( indexStart -1 , "never")
            traslEnd = nodeDisp.get( indexEnd -1 , "never")
            if len( traslStart ) == 2:
                traslStart = nodeDisp.get( indexStart -1 , "never")[0]
                traslEnd = nodeDisp.get( indexEnd -1 , "never")[0]
            pointStart = node.get( indexStart -1 , "never")
            pointEnd = node.get( indexEnd -1 , "never")
            #print( traslStart[1] )
            line = rg.LineCurve( pointStart,  pointEnd )
    
            axis1 =  rg.Vector3d( propSection[9][0][0], propSection[9][0][1], propSection[9][0][2]  )
            axis2 =  rg.Vector3d( propSection[9][1][0], propSection[9][1][1], propSection[9][1][2]  )
            axis3 =  rg.Vector3d( propSection[9][2][0], propSection[9][2][1], propSection[9][2][2]  )
            versor = [ axis1, axis2, axis3 ] 
            #---------- WORLD PLANE on point start of line ---------------#
            traslPlane = rg.Transform.Translation( pointStart.X, pointStart.Y, pointStart.Z )
            WorldPlane.Transform( traslPlane )
            #-------------------------------------------------------------#
            planeStart = rg.Plane(pointStart, axis1, axis2 )
            #planeStart = rg.Plane(pointStart, axis3 )
            localPlane = planeStart
            xform = rg.Transform.ChangeBasis( WorldPlane, localPlane )
            localTraslStart = rg.Vector3d( traslStart )
            vectorTrasform = rg.Transform.TransformList( xform, [ traslStart , traslEnd ] )
            #print( vectorTrasform[0] )
            localTraslStart = vectorTrasform[0]
            uI1 = localTraslStart.X # spostamento in direzione dell'asse rosso 
            uI2 = localTraslStart.Y # spostamento in direzione dell'asse verde
            uI3 = localTraslStart.Z # spostamento linea d'asse
            localTraslEnd = vectorTrasform[1]
            uJ1 = localTraslEnd.X # spostamento in direzione dell'asse rosso 
            uJ2 = localTraslEnd.Y # spostamento in direzione dell'asse verde
            uJ3 = localTraslEnd.Z # spostamento linea d'asse
            ##-------------- displacement value -------------------------##
            Length = rg.Curve.GetLength( line )
            segmentCount = Length/0.5
            DivCurve = line.DivideByCount( segmentCount, True )
            if DivCurve == None:
                DivCurve = [ 0, Length]
            defPoint = []
            defSection = []
            globalTransVector = []
            #----------------------- local to global-------------------------#
            xform2 = xform.TryGetInverse()
            #----------------------------------------------------------------#
            for index, x in enumerate(DivCurve):
                beamPoint = line.PointAt(DivCurve[index]) 
                ## SPOSTAMENTO IN DIREZIONE DELL' ASSE 3 ##
                u3 = spostu(x, Length, uI3, uJ3)
                u3Vector = u3*axis3
                ## SPOSTAMENTO IN DIREZIONE DELL' ASSE 1 ##
                v1 =  x*( uJ1 - uI1 )/Length + uI1
                v1Vector = v1*axis1 
                ## SPOSTAMENTO IN DIREZIONE DELL' ASSE 2 ##
                v2 =  x*( uJ2 - uI2 )/Length + uI2
                v2Vector = v2*axis2 
                ## RISULTANTE SPOSTAMENTI ##
                transResult = v1Vector + v2Vector + u3Vector
                trasl = rg.Transform.Translation( transResult*scale )
                beamPoint.Transform( trasl )
                defPoint.append( beamPoint )
                sectionPlane = rg.Plane( beamPoint, axis1, axis2 )
                if dimSection[0] == 'rectangular' :
                    width, height = dimSection[1], dimSection[2]
                    section = AddRectangleFromCenter( sectionPlane, width, height )
                    defSection.append( section )
                elif dimSection[0] == 'circular' :
                    radius1  = dimSection[1]/2
                    radius2  = dimSection[1]/2 - dimSection[2]
                    section1 = AddCircleFromCenter( sectionPlane, radius1 )
                    if (radius1 - radius2 ) == 0 :
                        defSection.append( section1 )
                    else :
                        section2 = AddCircleFromCenter( sectionPlane, radius2 )
                        defSection.append( [ section1, section2 ] )
                elif dimSection[0] == 'doubleT' :
                    Bsup = dimSection[1]
                    tsup = dimSection[2]
                    Binf = dimSection[3]
                    tinf = dimSection[4]
                    H =  dimSection[5]
                    ta =  dimSection[6]
                    yg =  dimSection[7]
                    section = AddIFromCenter( sectionPlane, Bsup, tsup, Binf, tinf, H, ta, yg )
                    defSection.append( section )
                elif dimSection[0] == 'Generic' :
                    radius  = dimSection[1]
                    section = AddCircleFromCenter( sectionPlane, radius )
                    defSection.append( section )
            
                globalTrasl = rg.Vector3d( transResult ) 
                globalTrasl.Transform(xform2[1]) 
                globalTrasl.Transform(xform)
                globalTransVector.append( globalTrasl )
    
           
            defpolyline = rg.PolylineCurve( defPoint )
    
            if dimSection[0] == 'circular' :
                radius1  = dimSection[1]/2
                radius2  = dimSection[1]/2 - dimSection[2]
                if (radius1 - radius2 ) == 0:
                    meshdef = meshLoft3( defSection,  color )
    
                else :
                    defSection1 = [row[0] for row in defSection ]
                    defSection2 = [row[1] for row in defSection ]
                    meshdef = meshLoft3( defSection1,  color )
                    meshdef.Append( meshLoft3( defSection2,  color ) )
                    #print( meshdef )
    
            else  :
                meshdef = meshLoft3( defSection,  color )
            return  [ defpolyline, meshdef, globalTransVector] 
        ## Mesh from close section eith gradient color ##
        def meshLoft3( point, color ):
            #print( point )
            meshEle = rg.Mesh()
            pointSection1 = point
            for i in range(0,len(pointSection1)):
                for j in range(0, len(pointSection1[0])):
                    vertix = pointSection1[i][j]
                    #print( type(vertix) )
                    meshEle.Vertices.Add( vertix ) 
                    #meshEle.VertexColors.Add( color[0],color[1],color[2] );
            k = len(pointSection1[0])
            for i in range(0,len(pointSection1)-1):
                for j in range(0, len(pointSection1[0])):
                    if j < k-1:
                        index1 = i*k + j
                        index2 = (i+1)*k + j
                        index3 = index2 + 1
                        index4 = index1 + 1
                    elif j == k-1:
                        index1 = i*k + j
                        index2 = (i+1)*k + j
                        index3 = (i+1)*k
                        index4 = i*k
                    meshEle.Faces.AddFace(index1, index2, index3, index4)
                    #rs.ObjectColor(scyl,(255,0,0))
            colour = rs.CreateColor( color[0], color[1], color[2] )
            meshEle.VertexColors.CreateMonotoneMesh( colour )
            meshElement = meshEle
            #meshdElement.IsClosed(True)
            
            return meshElement
    
        def gradient(value, valueMin, valueMax, colorList ):
    
            if colorList == [] :
                listcolor = [ rs.CreateColor( 201, 0, 0 ),
                            rs.CreateColor( 240, 69, 7),
                            rs.CreateColor( 251, 255, 0 ),
                            rs.CreateColor( 77, 255, 0 ),
                            rs.CreateColor( 0, 255, 221 ),
                            rs.CreateColor( 0, 81, 255 )]
            else :
                listcolor = colorList
    
            n = len( listcolor )
            domain = linspace( valueMin, valueMax, n)
            #print( domain )
            
            for i in range(1,n+1):
                if  domain[i-1] <= value <= domain[i] :
                    return listcolor[ i-1 ]
                elif  valueMax <= value <= valueMax + 0.0000000000001 :
                    return listcolor[ -1 ]
                elif  valueMin - 0.0000000000001 <= value <= valueMin  :
                    return listcolor[ 0 ]
                    
        def updateComponent(interval):
            
            ## Updates this component, similar to using a grasshopper timer 
            
            # Define callback action
            def callBack(e):
                ghenv.Component.ExpireSolution(False)
            
            # Get grasshopper document
            ghDoc = ghenv.Component.OnPingDocument()
            
            # Schedule this component to expire
            ghDoc.ScheduleSolution(interval,gh.Kernel.GH_Document.GH_ScheduleDelegate(callBack)) # Note that the first input here is how often to update the component (in milliseconds)
                
        def ModalView(AlpacaModalOutput, numberMode, speed, Animate, Reset, scale, direction, modelExtrude, colorList ):
        
            global myCounter
            
            
            Animate = False if Animate is None else Animate
            numberMode = 1 if numberMode is None else numberMode
            Reset = False if Reset is None else Reset
            speed = 1 if speed is None else speed
            modelExtrude = True if modelExtrude is None else modelExtrude
            direction = 3 if direction is None else direction
                    
                
                
            global ModelDisp
            global ModelCurve
            global ModelShell
            global ModelSolid
            global dimSection
            #global ExtrudedModel
        
            diplacementWrapper = AlpacaModalOutput[0][numberMode-1] # number of mode will start from 1. First, Second, Third ect ect
            EleOut = AlpacaModalOutput[1]
            Period = AlpacaModalOutput[3]
        
        
            # Instantiate/reset persisent starting counter variable
            if "myCounter" not in globals() or Reset :
                myCounter = 0
        
            # Update the variable and component
            if Animate and not Reset:
                myCounter += 1/ ( (speed) * 10 )
                updateComponent(1)
        
            # Output counter
        
            T = Period[numberMode-1]
            w = 2 * mt.pi/T
            #At = math.sin(myCounter)
        
            At = mt.sin(myCounter * w + mt.pi/2)
        
            nodeValue = []
            displacementValue = []
            #ShellOut = AlpacaModalOutput[4]
        
            pointWrapper = []
            dispWrapper = []
        
            for index,item in enumerate(diplacementWrapper):
                nodeValue.append( item[0] )
                displacementValue.append( item[1] )
                pointWrapper.append( [index, rg.Point3d(item[0][0],item[0][1],item[0][2]) ] )
                if len(item[1]) == 3:
                    dispWrapper.append( [index, rg.Point3d( item[1][0], item[1][1], item[1][2] ) ] )
                elif len(item[1]) == 6:
                    dispWrapper.append( [index, [rg.Point3d(item[1][0],item[1][1],item[1][2] ), rg.Point3d(item[1][3],item[1][4],item[1][5]) ] ] )
        
            ## Dict. for point ##
            pointWrapperDict = dict( pointWrapper )
            pointDispWrapperDict = dict( dispWrapper )
            ####
        
            ## FOR scala automatica ##
            ## nodeValue è la lista delle cordinate
            rowX = [row[0] for row in nodeValue ]
            rowY = [row[1] for row in nodeValue ]
            rowZ = [row[2] for row in nodeValue ]
        
            scaleMax = max( max(rowX), max(rowY), max(rowZ) )
            scaleMin = min( min(rowX), min(rowY), min(rowZ) )
            coordMax = max( mt.fabs(scaleMin),mt.fabs(scaleMax)) - mt.fabs(scaleMin)
        
            ## displacementValue è la lista degli spostamenti
        
            rowDefX = [row[0] for row in displacementValue ]
            rowDefY = [row[1] for row in displacementValue ]
            rowDefZ = [row[2] for row in displacementValue ]
        
            defMax = max( max(rowDefX), max(rowDefY), max(rowDefZ) )
            defMin = min( min(rowDefX), min(rowDefY), min(rowDefZ) )
            DefMax = max( mt.fabs(defMax),mt.fabs(defMin))
        
            if scale is None:
                scaleDef = scaleAutomatic( coordMax , DefMax )/10
        
            else :
                scaleDef = scale
        
            modelDisp = []
            modelCurve = []
            ShellDefModel = []
            ExtrudedView = []
        
            traslBeamValue = []
            rotBeamValue = []
        
            traslShellValue = []
            rotShellValue = []
            ExtrudedShell = []
        
            SolidDefModel = []
            traslSolidValue = []
        
        
            for ele in EleOut :
                eleType = ele[2][0]
                nNode = len( ele[1] )
                
                if eleType == 'ElasticTimoshenkoBeam' :
                    
                    dimSection = ele[2][10]
                    color = ele[2][12]
                    valueTBeam = defValueTimoshenkoBeam( ele, pointWrapperDict, pointDispWrapperDict, scaleDef*At )
                    defpolyline = valueTBeam[0]
                    meshdef = valueTBeam[1]
                    globalTrans = valueTBeam[2]
                    globalRot = valueTBeam[3]
                    traslBeamValue.append( globalTrans ) 
                    rotBeamValue.append( globalRot )
                    modelCurve.append( defpolyline )
                    modelDisp.append( defpolyline )
                    # estrusione della beam #
                    ExtrudedView.append( meshdef )
                elif eleType == 'Truss' :
                    dimSection = ele[2][10]
                    color = ele[2][12]
                    #print( color )
                    valueTruss = defTruss( ele, pointWrapperDict, pointDispWrapperDict, scaleDef*At )
                    defpolyline = valueTruss[0]
                    meshdef = valueTruss[1]
                    globalTrans = valueTruss[2]
                    traslBeamValue.append( globalTrans ) 
                    modelCurve.append( defpolyline )
                    ExtrudedView.append( meshdef )
                    modelDisp.append( defpolyline )
        
                elif nNode == 4 and eleType != 'FourNodeTetrahedron':
                    shellDefModel = defShellQuad( ele, pointWrapperDict, pointDispWrapperDict, scaleDef*At )
                    ShellDefModel.append( shellDefModel[0] )
                    traslShellValue.append( shellDefModel[1] )
                    rotShellValue.append( shellDefModel[2] )
                    extrudeShell = shellDefModel[3]
                    ExtrudedView.append( extrudeShell )
                    
                elif nNode == 3:
                    #print( nNode )
                    shellDefModel = defShellTriangle( ele, pointWrapperDict, pointDispWrapperDict, scaleDef*At )
                    ShellDefModel.append( shellDefModel[0] )
                    traslShellValue.append( shellDefModel[1] )
                    rotShellValue.append( shellDefModel[2] )
                    extrudeShell = shellDefModel[3]
                    ExtrudedView.append( extrudeShell )
        
                    
                elif nNode == 8:
                    solidDefModel = defSolid( ele, pointWrapperDict, pointDispWrapperDict, scaleDef*At )
                    SolidDefModel.append( solidDefModel[0] )
                    doc.Objects.AddMesh( solidDefModel[0] )
                    traslSolidValue.append( solidDefModel[1] )
                    ExtrudedView.append( solidDefModel[0] )
                    
                elif  eleType == 'FourNodeTetrahedron' :
                    #print(ele)
                    solidDefModel = defTetraSolid( ele, pointWrapperDict, pointDispWrapperDict, scaleDef*At )
                    SolidDefModel.append( solidDefModel[0] )
                    traslSolidValue.append( solidDefModel[1] )
                    ExtrudedView.append( solidDefModel[0] )
        
            ########################################################################################################################
            # MAX an MIN VALOR
            valorVector = []
            # beam valor #
            for valuetrasl in traslBeamValue:
                for valor in valuetrasl:
                    vectorTrasl = rg.Vector3d( valor )
                    if direction == 0:
                        valorVector.append( vectorTrasl.X ) 
                    elif direction == 1:
                        valorVector.append( vectorTrasl.Y )
                    elif direction == 2:
                        valorVector.append( vectorTrasl.Z ) 
                    elif direction == 3:
                        valorVector.append( vectorTrasl.Length )     
            # POINT #
            if len(dispWrapper[0][1]) == 3 :
                PointDisp = [row[1] for row in dispWrapper ] 
            else:
                PointDisp = [row[1][0] for row in dispWrapper ]
        
            for nodeDisp in PointDisp :
                vectorNodeDisp = rg.Vector3d( nodeDisp )
                if direction == 0:
                    valorVector.append( vectorNodeDisp.X ) 
                elif direction == 1:
                    valorVector.append( vectorNodeDisp.Y )
                elif direction == 2:
                    valorVector.append( vectorNodeDisp.Z ) 
                elif direction == 3:
                    valorVector.append( vectorNodeDisp.Length )
            # MAX end MIN on structures point #
            lowerLimit = min( valorVector )
            upperLimit = max( valorVector )
            domainValues = [ lowerLimit, upperLimit ]
            print( lowerLimit, upperLimit )
        #####################################################################################
            colorBeam = []
            numberDivide = []
            for value in traslBeamValue :
                colorValor = []
                for valor in value:
                    vectorTrasl = rg.Vector3d( valor )
        
                    if direction == 0:
                        valorVector = vectorTrasl.X  
                    elif direction == 1:
                        valorVector = vectorTrasl.Y 
                    elif direction == 2:
                        valorVector = vectorTrasl.Z  
                    elif direction == 3:
                        valorVector = vectorTrasl.Length
        
                    #print( valorVector )
        
                    color = gradient( valorVector, lowerLimit, upperLimit, colorList )
                    colorValor.append( color )
                colorBeam.append( colorValor )
                numberDivide.append( len(colorValor) )
            #print( modelCurve[0])
            segment = []
            for curve, segmentCount in zip( modelCurve, numberDivide ):
                #print(segmentCount)
                parameter = curve.DivideByCount( segmentCount - 1, True )
                segmentCurve = []
                for i in range(1, len(parameter)) :
                        p1 =  rg.Curve.PointAt( curve, parameter[i-1] ) 
                        p2 = rg.Curve.PointAt( curve, parameter[i] )
                        segmentCurve.append( rg.Line( p1, p2 ) )
                segment.append( segmentCurve )
        
                #print( segment )
        
            
            for shellEle, value in zip(ShellDefModel,traslShellValue) :
                shellColor = shellEle.DuplicateMesh()
                shellColor.VertexColors.Clear()
                for j in range( 0,shellEle.Vertices.Count ):
                    vectorTrasl = rg.Vector3d( value[j] )
                    if direction == 0:
                        valorVector = vectorTrasl.X  
                    elif direction == 1:
                        valorVector = vectorTrasl.Y 
                    elif direction == 2:
                        valorVector = vectorTrasl.Z  
                    elif direction == 3:
                        valorVector = vectorTrasl.Length
        
                    color = gradient( valorVector, lowerLimit, upperLimit, colorList )
                    shellColor.VertexColors.Add( color )
                modelDisp.append( shellColor)
            #dup.VertexColors.CreateMonotoneMesh(Color.Red)
            #doc.Objects.AddMesh(dup)
            for solidEle, value in zip(SolidDefModel,traslSolidValue) :
                solidColor = solidEle.DuplicateMesh()
                solidColor.VertexColors.Clear()
                for j in range(0,solidEle.Vertices.Count):
                    vectorTrasl = rg.Vector3d( value[j] )
                    if direction == 0:
                        valorVector = vectorTrasl.X  
                    elif direction == 1:
                        valorVector = vectorTrasl.Y 
                    elif direction == 2:
                        valorVector = vectorTrasl.Z  
                    elif direction == 3:
                        valorVector = vectorTrasl.Length
        
                    color = gradient( valorVector, lowerLimit, upperLimit, colorList )
                    solidColor.VertexColors.Add( color )
                modelDisp.append( solidColor )
                    #rg.Collections.MeshVertexColorList.SetColor( solidEle,j, color[0], color[1], color[2] )
        
        
            if modelExtrude == False or modelExtrude == None :
                self.line = segment
                self.colorLine = colorBeam
                return modelDisp
                
            else:
                self.line = []
                self.colorLine = []
                return ExtrudedView
                
                
                
        checkData = True
        
        if not AlpacaModalOutput:
            checkData = False
            msg = "input 'AlpacaModalOutput' failed to collect data"
            ghenv.Component.AddRuntimeMessage(gh.Kernel.GH_RuntimeMessageLevel.Warning, msg)
        
        if checkData != False:
            modelDisp = ModalView(AlpacaModalOutput, numberMode, speed, Animate, Reset, scale, direction,modelExtrude, colorList )
            return (modelDisp)
            
    def DrawViewportWires(self,arg):
        
        for crvs, colors in zip(self.line, self.colorLine):
            for crv, color in zip(crvs, colors):
                arg.Display.DrawLine(crv, color, 4)
# ---------- end ghpython_script_45 ----------

# ----
geometry_7 = Geometry(ghpython_script_45)
cloud_display = CloudDisplay(Points=move_12.Geometry, Colours=RGB(255, 20, 147), Size=1, SpriteType=0)  # disabled
text_tag = TextTag(Location=list_item_4, Text=vector_length_2)  # disabled

# ---- group: brick Displacement
ghpython_script_46 = GhPythonScript(Code=read_file_17, AlpacaStaticOutput=analyze_4.AlpacaStaticOutput)  # -> Out, TagElement, Trans; disabled

# ---- group: Shell Displacement
ghpython_script_47 = GhPythonScript(Code=read_file_15, AlpacaStaticOutput=analyze_3.AlpacaStaticOutput)  # -> Out, TagElement, Trans, Rot; disabled

# ---- group: Beam Displacement
ghpython_script_48 = GhPythonScript(Code=read_file_14, AlpacaStaticOutput=analyze_3.AlpacaStaticOutput, NumberResults=number_slider_19)  # -> Out, TagElement, LocalTrans, LocalRot, GlobalTrans, GlobalRot; disabled

# ---- group: NodeDisp
ghpython_script_49 = GhPythonScript(Code=read_file_16, AlpacaStaticOutput=merge_14)  # -> Out, Points, Trans, Rot; disabled

# ----
# shell Component
panel_37 = Panel(ghpython_script_40.Mz)  # disabled

# ----
# OK!
file_path_36 = FilePath("C:\GitHub\Alpaca4d\PythonScript\Post-Processing\disassembleModel\disassembleModel.py")  # disabled
read_file_36 = ReadFile(File=file_path_36, PerLineParse=False)  # disabled

# ---- group: disassemble Model
ghpython_script_50 = GhPythonScript(Code=read_file_36, AlpacaModel=ghpython_script_33.AlpacaModel)  # -> Element, ExtrudedElement, Points, Support, Load, Material, Section; disabled

# ----
panel_38 = Panel(ghpython_script_50.ExtrudedElement)  # disabled

# ==== cluster Cluster
tree = ClusterInput()
tree_2 = ClusterInput()
gate = ClusterInput()
tree_3 = ClusterInput()
tree_statistics = TreeStatistics(Tree=tree_2)  # -> Paths, Length, Count
tree_statistics_2 = TreeStatistics(Tree=tree)  # -> Paths, Length, Count
cull_index = CullIndex(List=tree_statistics.Paths, Indices="0", Wrap=True)
tree_statistics_3 = TreeStatistics(Tree=tree_3)  # -> Paths, Length, Count
construct_path = ConstructPath(Indices="0")
cull_index_2 = CullIndex(List=tree_statistics_2.Paths, Indices="0", Wrap=True)
construct_path_2 = ConstructPath(Indices="0")
cull_index_3 = CullIndex(List=tree_statistics_3.Paths, Indices="0", Wrap=True)
tree_branch = TreeBranch(Tree=tree_2, Path=construct_path, MaintainPaths=True)
tree_branch_2 = TreeBranch(Tree=tree_2, Path=cull_index, MaintainPaths=True)
construct_path_3 = ConstructPath(Indices="0")
tree_branch_3 = TreeBranch(Tree=tree, Path=construct_path_2, MaintainPaths=True)
tree_branch_4 = TreeBranch(Tree=tree, Path=cull_index_2, MaintainPaths=True)
list_length = ListLength(List=tree_branch_2)
tree_branch_5 = TreeBranch(Tree=tree_3, Path=construct_path_3, MaintainPaths=True)
tree_branch_6 = TreeBranch(Tree=tree_3, Path=cull_index_3, MaintainPaths=True)
deconstruct_vector = DeconstructVector(Vector=tree_branch_4)  # -> XComponent, YComponent, ZComponent
vector_length = VectorLength(Vector=tree_branch_4)
divide_curve = DivideCurve(Curve=tree_branch, Count=flatten(list_length), Kinks=False)  # -> Points, Tangents, simplify(Parameters)
deconstruct_vector_2 = DeconstructVector(Vector=tree_branch_6)  # -> XComponent, YComponent, ZComponent
vector_length_2 = VectorLength(Vector=tree_branch_6)
stream_filter = StreamFilter(
    Gate=gate,
    Stream0=deconstruct_vector.XComponent,
    Stream1=deconstruct_vector.YComponent,
    Stream2=deconstruct_vector.ZComponent,
    Stream3=vector_length)
stream_filter_2 = StreamFilter(
    Gate=gate,
    Stream0=deconstruct_vector_2.XComponent,
    Stream1=deconstruct_vector_2.YComponent,
    Stream2=deconstruct_vector_2.ZComponent,
    Stream3=vector_length_2)
deconstruct_vector_3 = DeconstructVector(Vector=tree_branch_2)  # -> XComponent, YComponent, ZComponent
vector_length_3 = VectorLength(Vector=tree_branch_2)
merge = Merge(Data1=tree_branch_2, Data2=tree_branch_4, Data3=tree_branch_6)  # -> flatten(Result)
deconstruct_vector_4 = DeconstructVector(Vector=merge)  # -> XComponent, YComponent, ZComponent
stream_filter_3 = StreamFilter(
    Gate=gate,
    Stream0=deconstruct_vector_3.XComponent,
    Stream1=deconstruct_vector_3.YComponent,
    Stream2=deconstruct_vector_3.ZComponent,
    Stream3=vector_length_3)
vector_length_4 = VectorLength(Vector=merge)
stream_filter_4 = StreamFilter(
    Gate=gate,
    Stream0=deconstruct_vector_4.XComponent,
    Stream1=deconstruct_vector_4.YComponent,
    Stream2=deconstruct_vector_4.ZComponent,
    Stream3=vector_length_4)
bounds = Bounds(Numbers=flatten(stream_filter_4))
entwine = Entwine(Branch00=stream_filter_3, Branch01=stream_filter, Branch02=stream_filter_2, FlattenInputs=True)  # -> flatten(Result)
deconstruct_domain = DeconstructDomain(Domain=bounds)  # -> Start, End
bounds_2 = Bounds(Numbers=entwine)
shatter = Shatter(Curve=graft(tree_branch), Parameters=divide_curve.Parameters)  # -> simplify(graft(Segments))
domain = ClusterOutput(bounds_2)
gradient = Gradient(
    LowerLimit=deconstruct_domain.Start,
    UpperLimit=deconstruct_domain.End,
    Parameter=stream_filter_3,
    stops=[0.103: RGB(0, 0, 255), 0.22: RGB(0, 170, 255), 0.305: RGB(0, 255, 255), 0.398: RGB(0, 255, 188), 0.504: RGB(0, 255, 106), 0.605: RGB(91, 255, 0), 0.699: RGB(184, 255, 0), 0.799: RGB(255, 255, 0), 0.898: RGB(255, 170, 0)])
gradient_2 = Gradient(
    LowerLimit=deconstruct_domain.Start,
    UpperLimit=deconstruct_domain.End,
    Parameter=stream_filter,
    stops=[0.103: RGB(0, 0, 255), 0.22: RGB(0, 170, 255), 0.305: RGB(0, 255, 255), 0.398: RGB(0, 255, 188), 0.504: RGB(0, 255, 106), 0.605: RGB(91, 255, 0), 0.699: RGB(184, 255, 0), 0.799: RGB(255, 255, 0), 0.898: RGB(255, 170, 0)])
gradient_3 = Gradient(
    LowerLimit=deconstruct_domain.Start,
    UpperLimit=deconstruct_domain.End,
    Parameter=stream_filter_2,
    stops=[0.103: RGB(0, 0, 255), 0.22: RGB(0, 170, 255), 0.305: RGB(0, 255, 255), 0.398: RGB(0, 255, 188), 0.504: RGB(0, 255, 106), 0.605: RGB(91, 255, 0), 0.699: RGB(184, 255, 0), 0.799: RGB(255, 255, 0), 0.898: RGB(255, 170, 0)])
number_slider = Slider(3, range=0..10)
curve = Curve(flatten(shatter))
mesh_colours = MeshColours(Mesh=graft(tree_branch_5), Colours=gradient_3)
mesh_colours_2 = MeshColours(Mesh=graft(tree_branch_3), Colours=gradient_2)
custom_preview = CustomPreview(Geometry=curve, Material=flatten(gradient))

# ==== cluster Cluster_2
y_component = ClusterInput()
x_component = ClusterInput()
B = ClusterInput()
vector_xyz = VectorXYZ(XComponent=x_component, YComponent=y_component, ZComponent=0)  # -> Vector, Length
division = Division(A=vector_xyz.Vector, B=B)
negative = Negative(Value=division)
A = ClusterInput()
addition = Addition(A=A, B=negative)
vector_display_ex = VectorDisplayEx(Point=addition, Vector=division, Colour=ColourSwatch(SwatchColor=RGB(255, 0, 0)), Width=2)
