# Grasshopper definition EsempioGrattacielo.gh (Grasshopper 1.0.7)
# plug-ins: LunchBox, Kangaroo2 Components, karambaGH

# ---- group: Element
data = Data(0)
data_2 = Data(0)

# ---- group: Load
data_3 = Data(0)
data_4 = Data(0)

# ---- group: Cross-Section
data_5 = Data(0)
data_6 = Data(0)

# ---- group: Support
data_7 = Data(0)
data_8 = Data(0)

# ---- group: Material
data_9 = Data(0)
data_10 = Data(0)

# ---- group: Constraint
data_11 = Data(0)
# Model 0
# Model 1
data_12 = Data(0)

# ----
# Model 4
number_slider = Slider(25, range=0..100)
circle = Circle(Plane=PlaneXY(0, 0, 0), Radius=number_slider)

numero_di_piani = Slider(60, range=0..65)
# Model 5
altezza_interpiano = Panel("5")
multiplication = Multiplication(A=altezza_interpiano, B=numero_di_piani)
altezza_edificio_m = Panel(multiplication)

series = Series(Start="0", Step=altezza_interpiano, Count=numero_di_piani)
entwine = Entwine(Branch00=series, Branch01=altezza_edificio_m, FlattenInputs=True)  # -> flatten(Result)
unit_z = UnitZ(Factor=entwine)
move = Move(Geometry=graft(circle), Motion=unit_z)  # -> Geometry, Transform
tapering_type = ValueList({"bezeer": 0, "convesso": 1, "concavo": 2, "lineare": 3, "normal": 4}, selected="lineare")

# ---- group: Tapering
list_length = ListLength(List=move.Geometry)
area = Area(Geometry=move.Geometry)  # -> Area, Centroid
construct_domain = ConstructDomain(DomainStart="1", DomainEnd="0.4")
subtraction = Subtraction(A=list_length, B="1")
range = Range(Domain=construct_domain, Steps=subtraction)
graph_mapper = GraphMapper(
    range,
    x0=0,
    x1=1,
    y0=0,
    y1=1,
    container_name="Bezier",
    cpx=[0, 0.3873239458, 0.9225352407, 1],
    cpy=[0, 0.2681159377, 0.4202898741, 1])
graph_mapper_2 = GraphMapper(range, x0=0, x1=1, y0=0, y1=1, Cx=0.3467037678, Cy=0.5946323872, container_name="Conic")
graph_mapper_3 = GraphMapper(range, x0=0, x1=1, y0=0, y1=1, Cx=0.6321179271, Cy=0.3431414366, container_name="Conic")
graph_mapper_4 = GraphMapper(
    range,
    x0=0,
    x1=1,
    y0=0,
    y1=1,
    A=1,
    B=0,
    container_name="Linear",
    Graph_x0=0.25,
    Graph_x1=0.75,
    Graph_y0=0.25,
    Graph_y1=0.75)
graph_mapper_5 = GraphMapper(
    range,
    x0=0,
    x1=1,
    y0=0,
    y1=1,
    A=-0.00144982338,
    B=1,
    container_name="Linear",
    Graph_x0=0,
    Graph_x1=1,
    Graph_y0=1,
    Graph_y1=0.9985501766)
stream_filter = StreamFilter(
    Gate=tapering_type,
    Stream0=graph_mapper,
    Stream1=graph_mapper_2,
    Stream2=graph_mapper_3,
    Stream3=graph_mapper_4,
    Stream4=graph_mapper_5)
scale = Scale(Geometry=move.Geometry, Center=area.Centroid, Factor=stream_filter)  # -> simplify(Geometry), Transform

# ----
# Model 2
area_2 = Area(Geometry=move.Geometry)  # -> Area, Centroid
list_item = ListItem(List=area_2.Centroid, Index=0, Wrap=True)  # -> Item1, Item
line = Line(StartPoint=list_item.Item1, EndPoint=list_item.Item)
unit_x = UnitX(Factor="50")
move_2 = Move(Geometry=line, Motion=unit_x)  # -> Geometry, Transform
linear_dimension = LinearDimension(Line=move_2.Geometry, PointA=list_item.Item1, PointB=list_item.Item, Text="{0:0.00}", Size="5")

curve = Curve(scale.Geometry)
cull_index = CullIndex(List=curve, Indices="0", Wrap=True)
area_3 = Area(Geometry=cull_index)  # -> Area, Centroid
divide_curve = DivideCurve(Curve=cull_index, Count=Slider(20, range=0..100), Kinks=False)  # -> Points, Tangents, Parameters
distance = Distance(PointA=graft(area_3.Centroid), PointB=divide_curve.Points)
bounds = Bounds(Numbers=distance)
deconstruct_domain = DeconstructDomain(Domain=bounds)  # -> Start, End

panel = Panel(deconstruct_domain.Start)
panel_2 = Panel(deconstruct_domain.End)

# ---- group: Diametri
multiplication_2 = Multiplication(A=deconstruct_domain.Start, B="2")  # -> flatten(Result)
multiplication_3 = Multiplication(A=deconstruct_domain.End, B="2")  # -> flatten(Result)

# ----
ghpython_script = GhPythonScript(
    Zona=Slider(4, range=0..10),
    altitudine=Slider(400, range=0..1000),
    Tr=Slider(50, range=0..100),
    CategoriaEsposizione=Slider(4, range=0..10),
    H="300",
    hint="5")  # -> out, vm, vp, Iv, Lv, qp; inputs Zona: Int32, H: Int32, hint: Int32
# ---------- ghpython_script: Python ----------
__author__ = "domy7"
__version__ = "2020.08.11"

import math as mt

def vb( Zona, altitudine ) : # velocità base di riferimento
    if Zona == 1 :
        vb0 = 25
        a0 = 1000
        ka = 0.40
    elif Zona == 2 :
        vb0 = 25
        a0 = 750
        ka = 0.45
    elif Zona == 3 :
        vb0 = 27
        a0 = 500
        ka = 0.37
    elif Zona == 4 :
        vb0 = 28
        a0 = 500
        ka = 0.36
    elif Zona == 5 :
        vb0 = 28
        a0 = 750
        ka = 0.40
    elif Zona == 6 :
        vb0 = 28
        a0 = 500
        ka = 0.36
    elif Zona == 7 :
        vb0 = 28
        a0 = 1000
        ka = 0.54
    elif Zona == 8 :
        vb0 = 30
        a0 = 1500
        ka = 0.50
    elif Zona == 9 :
        vb0 = 31
        a0 = 500
        ka = 0.32
    
    if altitudine <= a0 :
        ca = 1
    elif altitudine > a0 :
        ca = 1 + ka*( altitudine/ a0 - 1 ) 
        
    return vb0*ca

def vr( vb, Tr ): # velocità di riferimento
    if Tr == 1:
        cr = 0.75
    elif Tr < 5 and Tr >= 1:
        cr = 0.75 + 0.0652*mt.log(Tr)
    elif Tr < 50 and Tr >= 5:
        cr = 0.75*mt.sqrt( 1 - 0.2*mt.log( - mt.log( 1 - 1/Tr )))
    elif Tr >= 50:
        cr = 0.65*( 1 - 0.138*mt.log( - mt.log( 1 - 1/Tr )))
    return vb*cr

def WindValorList( vr, CategoriaEsposizione, ct , H, hint): 
    if CategoriaEsposizione == 1:
        kr = 0.17
        z0 = 0.01
        zmin = 2
        k = 0.44
    elif CategoriaEsposizione == 2:
        kr = 0.19
        z0 = 0.01
        zmin = 4
        k = 0.52
    elif CategoriaEsposizione == 3:
        kr = 0.20
        z0 = 0.10
        zmin = 5
        k = 0.55
    elif CategoriaEsposizione == 4:
        kr = 0.22
        z0 = 0.30
        zmin = 8
        k = 0.61
    elif CategoriaEsposizione == 5:
        kr = 0.23
        z0 = 0.70
        zmin = 12
        k = 0.65
    vm = []
    Iv = []
    Lv = []
    qp = []
    vp = []
    for z in range( 0, H, hint ):
        if z <= zmin :
            iv = 1/( mt.log(zmin/z0)*ct )
            cm = kr*mt.log(zmin/z0)*ct
            lv = 300*(zmin/200)**k
            ce =kr**2*mt.log(zmin/z0)*ct*(mt.log(zmin/z0)*ct + 7 )
        elif z > zmin :
            cm = kr*mt.log(z/z0)*ct
            iv = 1/( mt.log(z/z0)*ct )
            lv = 300*(z/200)**k
            ce =kr**2*mt.log(z/z0)*ct*(mt.log(z/z0)*ct + 7 )
            
        vm.append( vr*cm ) # velocità media
        Iv.append( iv ) # intensità turbolenza
        Lv.append( lv ) # scala integrale della turbolenza
        rho = 1.25 # kg/m**3
        Gv = 1.5
        vp.append( vr*cm*Gv )
        qp.append( 0.5*rho*vr**2*ce )
    return vm, Iv, Lv, qp, vp


vb = vb( Zona, altitudine )
vr = vr( vb, Tr )
vm, Iv, Lv, qp,vp = WindValorList( vr, CategoriaEsposizione, 1 , H, hint)
# ---------- end ghpython_script ----------

list_item_2 = ListItem(List=multiplication_2, Index="-1", Wrap=True)
list_item_3 = ListItem(List=multiplication_3, Index="-1", Wrap=True)
cull_index_2 = CullIndex(List=multiplication_3, Indices="-1", Wrap=True)
cull_index_3 = CullIndex(List=multiplication_2, Indices="-1", Wrap=True)
division = Division(A=altezza_interpiano, B="2")
division_2 = Division(A=altezza_interpiano, B="2")
multiplication_4 = Multiplication(A=cull_index_3, B=altezza_interpiano)
multiplication_5 = Multiplication(A=list_item_2, B=division)
multiplication_6 = Multiplication(A=cull_index_2, B=altezza_interpiano)

# ---- group: KN/m2
division_3 = Division(A=ghpython_script.qp, B="1000")

# ----
multiplication_7 = Multiplication(A=list_item_3, B=division_2)
entwine_2 = Entwine(Branch00=multiplication_4, Branch01=multiplication_5, FlattenInputs=True)  # -> flatten(Result)
entwine_3 = Entwine(Branch00=multiplication_6, Branch01=multiplication_7, FlattenInputs=True)  # -> flatten(Result)
multiplication_8 = Multiplication(A=division_3, B=entwine_2)
multiplication_9 = Multiplication(A=division_3, B=entwine_3)

# ---- group: CERCHIO
drag_force = Panel("1.2")
drag_force_2 = Panel("1.2")
multiplication_10 = Multiplication(A=multiplication_9, B=drag_force)
multiplication_11 = Multiplication(A=multiplication_8, B=drag_force_2)
vector_xyz = VectorXYZ(XComponent=0, YComponent=multiplication_10, ZComponent=0)  # -> Vector, Length
vector_xyz_2 = VectorXYZ(XComponent=multiplication_11, YComponent=0, ZComponent=0)  # -> Vector, Length
entwine_4 = Entwine(Branch00=vector_xyz_2.Vector, Branch01=vector_xyz.Vector, FlattenInputs=True)

# ----
loft = Loft(Curves=scale.Geometry, Options={Adjust=False, Closed=False, LoftEnds=0, LoftSimp=0, LoftType=0, Rebuild=10, Refit=0.01})
diagrid_structure = DiagridStructure(Surface=loft, UDivisions=Slider(30, range=0..100), VDivisions=Slider(16, range=0..100), Type=True)  # -> StructureLines, StructureNodes

curve_2 = Curve(diagrid_structure.StructureLines)
divide_curve_2 = DivideCurve(Curve=curve_2, Count=Slider(2, range=0..10), Kinks=False)  # -> Points, Tangents, Parameters
removeduplicatepts = RemoveDuplicatePts(Points=flatten(divide_curve_2.Points), Tolerance=0.01)
deconstruct = Deconstruct(Point=flatten(removeduplicatepts))  # -> XComponent, YComponent, flatten(ZComponent)
shatter = Shatter(Curve=curve_2, Parameters=flatten(divide_curve_2.Parameters))  # -> simplify(flatten(Segments))
larger_than = LargerThan(FirstNumber=deconstruct.ZComponent, SecondNumber="0")  # -> LargerThan, OrEqualTo
dispatch = Dispatch(List=removeduplicatepts, DispatchPattern=larger_than.LargerThan)  # -> ListA, ListB
panel_3 = Panel(series)
partition_list = PartitionList(List=shatter, Size="64")
point = Point(dispatch.ListB)
point_2 = Point(dispatch.ListA)
cull_index_4 = CullIndex(List=panel_3, Indices="0", Wrap=True)
deconstruct_2 = Deconstruct(Point=point_2)  # -> XComponent, YComponent, ZComponent
tree_statistics = TreeStatistics(Tree=partition_list)  # -> Paths, Length, Count
list_length_2 = ListLength(List=cull_index_4)
subtraction_2 = Subtraction(A=tree_statistics.Count, B="2")
insert_items = InsertItems(List=cull_index_4, Item="300", Indices=list_length_2, Wrap=True)
similarity = Similarity(FirstNumber=deconstruct_2.ZComponent, SecondNumber=graft(insert_items), Threshold=0.1)  # -> Similarity, AbsoluteDifference
dispatch_2 = Dispatch(List=point_2, DispatchPattern=simplify(similarity.Similarity))  # -> simplify(ListA), simplify(ListB)
tree_branch = TreeBranch(Tree=dispatch_2.ListA, Path="{1}", MaintainPaths=True)
polyline = PolyLine(Vertices=dispatch_2.ListA, Closed=Toggle(True))
boundary_surfaces = BoundarySurfaces(Edges=polyline)
explode = Explode(Curve=polyline, Recursive=True)  # -> Segments, Vertices
area_4 = Area(Geometry=boundary_surfaces)  # -> Area, Centroid
mesh_breps_karamba3d = MeshBrepsKaramba3D(
    Brep=boundary_surfaces,
    InclusionPoints=area_4.Centroid,
    MeshResolution="50",
    EdgeRefinementFactor=0.67,
    PointReduction=False,
    SmoothingStepSize=0,
    SmoothingIterations=5)  # -> flatten(Mesh), Info

# ----
# UniaxialMaterial
# Elastic
file_path = FilePath("C:\GitHub\Alpaca4d\PythonScript\Pre-Processing\Material\uniAxialMaterial\ElasticUniaxialMaterial.py")
read_file = ReadFile(File=file_path, PerLineParse=False)
python = GhPythonScript(Code=read_file, MatName="S275", E="210000", G="80760", Rho="75", Fy="35")  # -> Out, UniaxialMaterial
python_2 = GhPythonScript(x=python.UniaxialMaterial)  # -> out, a
# ---------- python_2: Python ----------
a = x
# ---------- end python_2 ----------
panel_4 = Panel(python_2.a)

mesh = Mesh(mesh_breps_karamba3d.Mesh)

# ----
# UniaxialMaterial
# Elastic
panel_5 = Panel("210000")
python_3 = GhPythonScript(Code=read_file, MatName="S255", E=panel_5, G="80760", Rho="75", Fy="25")  # -> Out, UniaxialMaterial
python_4 = GhPythonScript(x=python_3.UniaxialMaterial)  # -> out, a; same code as python_2
panel_6 = Panel(python_4.a)

# ----
# nDMaterial
# ElasticIsotropic
file_path_2 = FilePath("C:\GitHub\Alpaca4d\PythonScript\Pre-Processing\Material\nDMaterial\ElasticIsotropic.py")
read_file_2 = ReadFile(File=file_path_2, PerLineParse=False)
python_5 = GhPythonScript(Code=read_file_2, MatName="S275", E="210000", G="80760", Rho="75", Fy="35")  # -> Out, NDMaterial

construct_domain_2 = ConstructDomain(DomainStart="100", DomainEnd="25")
construct_domain_3 = ConstructDomain(DomainStart="3000", DomainEnd="600")

# ----
# Support
file_path_3 = FilePath("C:\GitHub\Alpaca4d\PythonScript\Pre-Processing\Element\Support\Support.py")
toggle = BooleanToggle(True)
read_file_3 = ReadFile(File=file_path_3, PerLineParse=False)
point_3 = Point(point)
python_6 = GhPythonScript(Code=read_file_3, Pos=graft(point_3), Tx=toggle, Ty=Toggle(True), Tz=toggle, Rx=toggle, Ry=toggle, Rz=toggle)  # -> Out, flatten(SupportWrapper)
python_7 = GhPythonScript(x=python_6.SupportWrapper)  # -> out, a; same code as python_2
panel_7 = Panel(python_7.a)

range_2 = Range(Domain=construct_domain_2, Steps=subtraction_2)
range_3 = Range(Domain=construct_domain_3, Steps=subtraction_2)
explode_tree = ExplodeTree(Data=entwine_4)  # -> Branch0, Branch1
vector_xyz_3 = VectorXYZ(XComponent="100", YComponent=0, ZComponent=0)  # -> Vector, Length
negative = Negative(Value=explode_tree.Branch0)

# ----
# Generic Cross Section
file_path_4 = FilePath("C:\GitHub\Alpaca4d\PythonScript\Pre-Processing\Section\GenericCrossSection.py")
read_file_4 = ReadFile(File=file_path_4, PerLineParse=False)
python_8 = GhPythonScript(
    Code=read_file_4,
    SectionName="Generic",
    Area="20",
    Ay="20",
    Az="20",
    Iyy="20",
    Izz="20",
    J="20",
    UniaxialMaterial=python.UniaxialMaterial)  # -> Out, CrossSection

# ----
# Point Load
file_path_5 = FilePath("C:\GitHub\Alpaca4d\PythonScript\Pre-Processing\Load\PointLoad.py")
read_file_5 = ReadFile(File=file_path_5, PerLineParse=False)
point_4 = Point(flatten(area_4.Centroid))
vector = Vector(expr("x*0", Vector(2.518385542, -6.656153768, 0)))
vector_2 = Vector(negative)
python_9 = GhPythonScript(Code=read_file_5, Force=vector_2, Moment=vector, Pos=point_4)  # -> Out, flatten(LoadWrapper)

# ----
# Elastic Membrane Plate Section
file_path_6 = FilePath("C:\GitHub\Alpaca4d\PythonScript\Pre-Processing\Section\ElasticMembranePlateSection.py")
read_file_6 = ReadFile(File=file_path_6, PerLineParse=False)
python_10 = GhPythonScript(Code=read_file_6, SectionName="concreteSlab", Thickness="250", NDMaterial=python_5.NDMaterial)  # -> Out, CrossSection

# ----
# MassLoad
path = FilePath("C:\GitHub\Alpaca4d\PythonScript\Pre-Processing\Load\MassLoad.py")
pt = Point()
num = Number()
file = ReadFile(File=path, PerLineParse=False)
python_11 = GhPythonScript(Code=file, NodalMass=num, Pos=pt)  # -> Out, flatten(Mass); disabled

# ---- group: Rectangular Hollow Cross Section
file_path_7 = FilePath("C:\GitHub\Alpaca4d\PythonScript\Pre-Processing\Section\RectangularHollowCrossSection.py")
read_file_7 = ReadFile(File=file_path_7, PerLineParse=False)
panel_8 = Panel(range_3)
panel_9 = Panel(range_2)
python_12 = GhPythonScript(
    Code=read_file_7,
    SectionName="RHS",
    Base=panel_8,
    Height=panel_8,
    Thickness=panel_9,
    UniaxialMaterial=python_3.UniaxialMaterial)  # -> Out, CrossSection

# ----
negative_2 = Negative(Value=vector_2)

# ----
# Circular CrossSection
file_path_8 = FilePath("C:\GitHub\Alpaca4d\PythonScript\Pre-Processing\Section\CircularCrossSection.py")
read_file_8 = ReadFile(File=file_path_8, PerLineParse=False)
python_13 = GhPythonScript(Code=read_file_8, SectionName="CHS", Diameter="400", Thickness="40", UniaxialMaterial=python_3.UniaxialMaterial)  # -> Out, CrossSection

# ----
# Rectangular Cross Section
file_path_9 = FilePath("C:\GitHub\Alpaca4d\PythonScript\Pre-Processing\Section\RectangularCrossSection.py")
read_file_9 = ReadFile(File=file_path_9, PerLineParse=False)
python_14 = GhPythonScript(Code=read_file_9, SectionName="RHS", Base="300", Height="300", UniaxialMaterial=python.UniaxialMaterial)  # -> Out, CrossSection

move_3 = Move(Geometry=point_4, Motion=negative_2)  # -> Geometry, Transform

# ----
# doubleT CrossSection
file_path_10 = FilePath("C:\GitHub\Alpaca4d\PythonScript\Pre-Processing\Section\doubleTCrossSection.py")
read_file_10 = ReadFile(File=file_path_10, PerLineParse=False)
python_15 = GhPythonScript(
    Code=read_file_10,
    SectionName="TT",
    Bsup="300",
    Binf="600",
    H="500",
    Tsup="100",
    Tinf="100",
    Tw="100",
    UniaxialMaterial=python_3.UniaxialMaterial)  # -> Out, CrossSection

vector_display = VectorDisplay(Anchor=move_3.Geometry, Vector=vector_2)

# ----
# shell Component
# meshToShell
file_path_11 = FilePath("C:\GitHub\Alpaca4d\PythonScript\Pre-Processing\Element\MeshToShell\MeshToShell.py")
read_file_11 = ReadFile(File=file_path_11, PerLineParse=False)
python_16 = GhPythonScript(Code=read_file_11, Mesh=mesh, Colour=ColourSwatch(SwatchColor=RGB(161, 19, 242)), CrossSection=python_10.CrossSection)  # -> Out, flatten(ShellWrapper)

crv = Curve(partition_list)

data_13 = Data(python_9.LoadWrapper)

file_path_12 = FilePath("C:\GitHub\Alpaca4d\PythonScript\Pre-Processing\Element\LineToBeam\LineToBeam.py")
read_file_12 = ReadFile(File=file_path_12, PerLineParse=False)
crv_2 = Curve(explode.Segments)
python_17 = GhPythonScript(Code=read_file_12, Line=crv_2, Colour=ColourSwatch(SwatchColor=RGB(0, 255, 140)), CrossSection=python_15.CrossSection)  # -> Out, flatten(BeamWrapper)

swatch = ColourSwatch(SwatchColor=RGB(255, 200, 0))
list = ValueList({"Truss": 0, "Beam": 1}, selected="Beam")
python_18 = GhPythonScript(Code=read_file_12, Line=crv, CrossSection=python_12.CrossSection, OrientSection="0", BeamType=list)  # -> Out, flatten(BeamWrapper)

merge = Merge(Data1=python_17.BeamWrapper, Data2=python_18.BeamWrapper, Data3=python_16.ShellWrapper)
clean_tree = CleanTree(RemoveNulls=True, RemoveInvalid=True, RemoveEmpty=False, Tree=merge)
clean_tree_2 = CleanTree(RemoveNulls=True, RemoveInvalid=True, RemoveEmpty=False, Tree=python_6.SupportWrapper)
clean_tree_3 = CleanTree(RemoveNulls=True, RemoveInvalid=True, RemoveEmpty=False, Tree=data_13)
clean_tree_4 = CleanTree(RemoveNulls=True, RemoveInvalid=True, RemoveEmpty=False, Tree=python_11.Mass)

# ----
# Assemble
file_path_13 = FilePath("C:\GitHub\Alpaca4d\PythonScript\Pre-Processing\Assemble\Assemble.py")
read_file_13 = ReadFile(File=file_path_13, PerLineParse=False)
python_19 = GhPythonScript(
    Code=read_file_13,
    Element=flatten(clean_tree),
    Support=flatten(clean_tree_2),
    Load=flatten(clean_tree_3),
    Mass=flatten(clean_tree_4))  # -> Out, AlpacaModel, MassOfStructure

panel_10 = Panel(python_19.MassOfStructure)
path_2 = FilePath("C:\GitHub\Alpaca4d\PythonScript\Analyses\LinearAnalyses\initializeAnalysis.py")
panel_11 = Panel(path_2)
# solver on folder Static Analyses
file_2 = ReadFile(File=path_2, PerLineParse=False)
analyze = GhPythonScript(Code=file_2, AlpacaModel=python_19.AlpacaModel)  # -> Out, AlpacaStaticOutput, MaxDisplacement

# ----
# WIP
toggle_2 = BooleanToggle(False)
data_14 = Data(python_19.AlpacaModel)
python_20 = GhPythonScript(
    AlpacaModel=data_14,
    Model=Toggle(False),
    Support=toggle_2,
    Mass=Toggle(False),
    LocalAxis=Toggle(False),
    Load=Toggle(False),
    NodeTag=Toggle(False),
    ElementTag=Toggle(False))  # -> AlpacaModel, Model; inputs AlpacaModel: list, Model: Boolean, Support: Boolean, Mass: Boolean, LocalAxis: Boolean, Load: Boolean, NodeTag: Boolean, ElementTag: Boolean
# ---------- python_20: Python ----------
"""Generate Model view 
    Inputs:
        AlpacaModel: Output of Assemble Model.
        Model: True: Visualise the stick Model. Default is False
        ExtrudedModel: True: Visualise the Extruded Model. Default is True
        Support: True: Visualise the Support. Default is True
        Mass: True: Visualise the Concentrated Mass. Default is False
        LocalAxes: True: Visualise the LocalAxis. Default is False
        Load: True: Visualise the Load. Default is False
        NodeTag: True: Visualise the NodeTag. Default is False
        ElementTag: True: Visualise the ElementTag. Default is False
    Output:
        out:
"""

from ghpythonlib.componentbase import executingcomponent as component
import Grasshopper, GhPython
import System
import Rhino
import rhinoscriptsyntax as rs

class VisualiseModellll(component):
    
    def RunScript(self, AlpacaModel, Model, Support, Mass, LocalAxis, Load, NodeTag, ElementTag):
        
        import Rhino.Geometry as rg
        import math as mt
        import ghpythonlib.treehelpers as th
        import Grasshopper as gh
        import rhinoscriptsyntax as rs
        import sys
        import Rhino as rc
        import System.Drawing.Color
        import scriptcontext as sc
        
        
        def VisualiseModel(AlpacaModel, Model, Support, Mass, LocalAxis, Load, NodeTag, ElementTag):
        
            Model = False if Model is None else Model
            Support = True if Support is None else Support
            Mass = False if Mass is None else Mass
            LocalAxis = False if LocalAxis is None else LocalAxis
            Load = False if Load is None else Load
            NodeTag = False if NodeTag is None else NodeTag
            ElementTag = False if ElementTag is None else ElementTag
            
            
            def linspace(a, b, n=100):
                if n < 2:
                    return b
                diff = (float(b) - a)/(n - 1)
                return [diff * i + a  for i in range(n)]
            
            def AddRectangleFromCenter(plane, width, height):
                a = plane.PointAt(-width * 0.5, -height * 0.5 )
                b = plane.PointAt(-width * 0.5,  height * 0.5 )
                c = plane.PointAt( width * 0.5,  height * 0.5 )
                d = plane.PointAt( width * 0.5,  -height * 0.5 )
                #rectangle = rg.PolylineCurve( [a, b, c, d, a] )
                rectangle  = [a, b, c, d] 
                return rectangle
            
            def AddCircleFromCenter( plane, radius):
                t = linspace( 0 , 1.85*mt.pi, 15 )
                a = []
                for ti in t:
                    x = radius*mt.cos(ti)
                    y = radius*mt.sin(ti)
                    a.append( plane.PointAt( x, y ) )
                #circle = rg.PolylineCurve( a )
                circle  = a 
                return circle
            
            def AddIFromCenter(plane, Bsup, tsup, Binf, tinf, H, ta, yg):
                #-------------------1---------2 #
                p1 = plane.PointAt( -(yg - tinf), ta/2 )
                p2 = plane.PointAt( -(yg - tinf), Binf/2 )
                p3 = plane.PointAt( -yg, Binf/2 )
                p4 = plane.PointAt( -yg, -Binf/2 )
                p5 = plane.PointAt( -(yg - tinf), -Binf/2 ) 
                p6 = plane.PointAt( -(yg - tinf), -ta/2 )
                p7 = plane.PointAt( (H - yg - tsup), -ta/2)
                p8 = plane.PointAt( (H - yg - tsup), -Bsup/2 )
                p9 = plane.PointAt( (H - yg ), -Bsup/2 )
                p10 = plane.PointAt( (H - yg ), Bsup/2 )
                p11 = plane.PointAt( (H - yg - tsup), Bsup/2 )
                p12 = plane.PointAt( (H - yg - tsup), ta/2 )
            
                wirframe  = [ p1, p2, p3, p4, p5, p6, p7, p8, p9, p10, p11, p12 ] 
                return wirframe
            
            def ShellQuad( ele, node):
                eleTag = ele[1]
                eleNodeTag = ele[2]
                color = ele[5]
                thick = ele[4]
                index1 = eleNodeTag[0]
                index2 = eleNodeTag[1]
                index3 = eleNodeTag[2]
                index4 = eleNodeTag[3]
                
                ## CREO IL MODELLO  ##
                point1 = node.get( index1 -1 , "never")
                point2 = node.get( index2 -1 , "never")
                point3 = node.get( index3 -1 , "never")
                point4 =  node.get( index4 -1 , "never")
                
                shellModel = rg.Mesh()
                shellModel.Vertices.Add( point1 ) #0
                shellModel.Vertices.Add( point2 ) #1
                shellModel.Vertices.Add( point3 ) #2
                shellModel.Vertices.Add( point4 ) #3
                
                
                shellModel.Faces.AddFace(0, 1, 2, 3)
                colour = rs.CreateColor( color[0], color[1], color[2] )
                shellModel.VertexColors.CreateMonotoneMesh( colour )
            
                vt = shellModel.Vertices
                shellModel.FaceNormals.ComputeFaceNormals()
                fid,MPt = shellModel.ClosestPoint(vt[0],0.01)
                normalFace = shellModel.FaceNormals[fid]
                vectormoltiplicate = rg.Vector3d.Multiply( -normalFace, thick/2 )
                trasl = rg.Transform.Translation( vectormoltiplicate )
                moveShell = rg.Mesh.DuplicateMesh(shellModel)
                moveShell.Transform( trasl )
                extrudeShell = rg.Mesh.Offset( moveShell, thick, True, normalFace)
                
                return  [ shellModel, extrudeShell ] 
            
            def ShellTriangle( ele, node ):
                
                eleTag = ele[1]
                eleNodeTag = ele[2]
                thick = ele[4]
                color = ele[5]
                index1 = eleNodeTag[0]
                index2 = eleNodeTag[1]
                index3 = eleNodeTag[2]
                
                
                ## CREO IL MODELLO DEFORMATO  ##
                point1 =  node.get( index1 -1 , "never")
                point2 =  node.get( index2 -1 , "never")
                point3 =  node.get( index3 -1 , "never")
                
                shellModel = rg.Mesh()
                shellModel.Vertices.Add( point1 ) #0
                shellModel.Vertices.Add( point2 ) #1
                shellModel.Vertices.Add( point3 ) #2
                
                shellModel.Faces.AddFace(0, 1, 2)
                colour = rs.CreateColor( color[0], color[1], color[2] )
                shellModel.VertexColors.CreateMonotoneMesh( colour )
                
                vt = shellModel.Vertices
                shellModel.FaceNormals.ComputeFaceNormals()
                fid,MPt = shellModel.ClosestPoint(vt[0],0.01)
                normalFace = shellModel.FaceNormals[fid]
                vectormoltiplicate = rg.Vector3d.Multiply( -normalFace, thick/2 ) 
                trasl = rg.Transform.Translation( vectormoltiplicate )
                moveShell = rg.Mesh.DuplicateMesh(shellModel)
                moveShell.Transform( trasl )
                extrudeShell = rg.Mesh.Offset( moveShell, thick, True, normalFace)
                
                return  [ shellModel, extrudeShell ]
            
            def Solid( ele, node ):
                
                eleTag = ele[1]
                eleNodeTag = ele[2]
                color = ele[5]
                #print( eleNodeTag )
                index1 = eleNodeTag[0]
                index2 = eleNodeTag[1]
                index3 = eleNodeTag[2]
                index4 = eleNodeTag[3]
                index5 = eleNodeTag[4]
                index6 = eleNodeTag[5]
                index7 = eleNodeTag[6]
                index8 = eleNodeTag[7]
                
                ## CREO IL MODELLO DEFORMATO  ##
                point1 =  node.get( index1 -1 , "never")
                point2 =  node.get( index2 -1 , "never")
                point3 =  node.get( index3 -1 , "never")
                point4 =  node.get( index4 -1 , "never")
                point5 =  node.get( index5 -1 , "never")
                point6 =  node.get( index6 -1 , "never")
                point7 =  node.get( index7 -1 , "never")
                point8 =  node.get( index8 -1 , "never")
                #print( type(pointDef1) ) 
                shellDefModel = rg.Mesh()
                shellDefModel.Vertices.Add( point1 ) #0
                shellDefModel.Vertices.Add( point2 ) #1
                shellDefModel.Vertices.Add( point3 ) #2
                shellDefModel.Vertices.Add( point4 ) #3
                shellDefModel.Vertices.Add( point5 ) #4
                shellDefModel.Vertices.Add( point6 ) #5
                shellDefModel.Vertices.Add( point7 ) #6
                shellDefModel.Vertices.Add( point8 ) #7
            
                shellDefModel.Faces.AddFace(0, 1, 2, 3)
                shellDefModel.Faces.AddFace(4, 5, 6, 7)
                shellDefModel.Faces.AddFace(0, 1, 5, 4)
                shellDefModel.Faces.AddFace(1, 2, 6, 5)
                shellDefModel.Faces.AddFace(2, 3, 7, 6)
                shellDefModel.Faces.AddFace(3, 0, 4, 7)
                
                colour = rs.CreateColor( color[0], color[1], color[2] )
                shellDefModel.VertexColors.CreateMonotoneMesh( colour )
                return  shellDefModel
            
            def TetraSolid( ele, node ):
                
                eleTag = ele[1]
                eleNodeTag = ele[2]
                color = ele[5]
                #print( eleNodeTag )
                index1 = eleNodeTag[0]
                index2 = eleNodeTag[1]
                index3 = eleNodeTag[2]
                index4 = eleNodeTag[3]
                
                ## CREO IL MODELLO DEFORMATO  ##
                point1 =  node.get( index1 -1 , "never")
                point2 =  node.get( index2 -1 , "never")
                point3 =  node.get( index3 -1 , "never")
                point4 =  node.get( index4 -1 , "never")
                
                #print( type(pointDef1) )
                
                shellDefModel = rg.Mesh()
                shellDefModel.Vertices.Add( point1 ) #0
                shellDefModel.Vertices.Add( point2 ) #1
                shellDefModel.Vertices.Add( point3 ) #2
                shellDefModel.Vertices.Add( point4 ) #3
                
                
                shellDefModel.Faces.AddFace( 0, 1, 2 )
                shellDefModel.Faces.AddFace( 0, 1, 3 )
                shellDefModel.Faces.AddFace( 1, 2, 3 )
                shellDefModel.Faces.AddFace( 0, 2, 3 )
                colour = rs.CreateColor( color[0], color[1], color[2], 0 )
                shellDefModel.VertexColors.CreateMonotoneMesh( colour )
                
                return  shellDefModel
            
            def Beam( ele, node):
                TagEle = ele[1]
                indexStart = ele[2][0]
                indexEnd = ele[2][1]
                color = ele[16]
                dimSection = ele[14]
                pointStart = node.get( indexStart  , "never")
                pointEnd = node.get( indexEnd  , "never")
                line = rg.LineCurve( pointStart, pointEnd )
                axis1 =  rg.Vector3d( ele[13][0][0], ele[13][0][1], ele[13][0][2]  )
                axis2 =  rg.Vector3d( ele[13][1][0], ele[13][1][1], ele[13][1][2]  )
                axis3 =  rg.Vector3d( ele[13][2][0], ele[13][2][1], ele[13][2][2]  )
                versor = [ axis1, axis2, axis3 ] 
                
                planeStart = rg.Plane(pointStart, axis1, axis2)
                planeEnd = rg.Plane(pointEnd, axis1, axis2)
                plane = [ planeStart, planeEnd ]
                
                sectionForm = []
                sectionPolyline = []
                for sectionPlane in plane:
                    
                    if dimSection[0] == 'rectangular' :
                        width, height = dimSection[1], dimSection[2]
                        section = AddRectangleFromCenter( sectionPlane, width, height )
                        sectionForm.append( section )
                    elif dimSection[0] == 'circular' :
                        radius1  = dimSection[1]/2
                        radius2  = dimSection[1]/2 - dimSection[2]
                        section1 = AddCircleFromCenter( sectionPlane, radius1 )
                        section2 = AddCircleFromCenter( sectionPlane, radius2 )
                        sectionForm.append( [ section1, section2 ] )
                    elif dimSection[0] == 'doubleT' :
                        Bsup = dimSection[1]
                        tsup = dimSection[2]
                        Binf = dimSection[3]
                        tinf = dimSection[4]
                        H =  dimSection[5]
                        ta =  dimSection[6]
                        yg =  dimSection[7]
                        section = AddIFromCenter( sectionPlane, Bsup, tsup, Binf, tinf, H, ta, yg )
                        sectionForm.append( section )
                    elif dimSection[0] == 'rectangularHollow' :
                        width, height, thickness = dimSection[1], dimSection[2], dimSection[3]
                        section1 = AddRectangleFromCenter( sectionPlane, width, height )
                        section2 = AddRectangleFromCenter( sectionPlane, width - (2*thickness), height - (2*thickness) )
                        sectionForm.append( [ section1, section2 ] )
                    elif dimSection[0] == 'Generic' :
                        radius  = dimSection[1]
                        section = AddCircleFromCenter( sectionPlane, radius )
                        sectionForm.append( section )
                    #print(sectionForm)
            
                colour = rs.CreateColor( color[0], color[1], color[2] )
            
                if dimSection[0] == 'circular' :
                    sectionForm1 = [row[0] for row in sectionForm ]
                    sectionForm2 = [row[1] for row in sectionForm ]
                    meshExtr = meshLoft3( sectionForm1,  color )
                    meshExtr.Append( meshLoft3( sectionForm2,  color ) )
                    sectionStartEnd = [ [sectionForm1[0], sectionForm2[0]], [sectionForm1[-1], sectionForm2[-1]]  ]
                    for iSection in sectionStartEnd :
                        iMesh = rg.Mesh()
                        for iPoint, jPoint in zip(iSection[0],iSection[1])  :
                            iMesh.Vertices.Add( iPoint )
                            iMesh.Vertices.Add( jPoint )
                        for i in range(0,len(iSection[0]) - 1): # sistemare
                            index1 = i*2 # 0
                            index2 = index1 + 1 #1
                            index3 = index1 + 3 #2
                            index4 = index1 + 2 #3
                            iMesh.Faces.AddFace(index1, index2, index3, index4)
                        iMesh.Faces.AddFace(index4, index3, 1, 0)
                        iMesh.VertexColors.CreateMonotoneMesh( colour )
                        meshExtr.Append( iMesh )
                        #meshExtr.IsClosed()
                elif  dimSection[0] == 'rectangular' : 
                    meshExtr = meshLoft3( sectionForm,  color )
                    sectionStartEnd = [ sectionForm[0], sectionForm[-1] ]
                    for iSection in sectionStartEnd :
                        iMesh = rg.Mesh()
                        for iPoint in iSection :
                             iMesh.Vertices.Add( iPoint )
                        iMesh.Faces.AddFace(0, 1, 2, 3)
                        iMesh.VertexColors.CreateMonotoneMesh( colour )
                        meshExtr.Append( iMesh )
                elif  dimSection[0] == 'doubleT' : 
                    meshExtr = meshLoft3( sectionForm,  color )
                    sectionStartEnd = [ sectionForm[0], sectionForm[-1] ]
                    for iSection in sectionStartEnd :
                        iMesh = rg.Mesh()
                        for iPoint in iSection :
                             iMesh.Vertices.Add( iPoint )
                        iMesh.Faces.AddFace( 0, 1, 2 )
                        iMesh.Faces.AddFace(2, 3, 5, 0 )
                        iMesh.Faces.AddFace( 3, 4, 5 )
                        iMesh.Faces.AddFace( 5, 6, 11, 0 )
                        iMesh.Faces.AddFace( 6, 7, 8 )
                        iMesh.Faces.AddFace( 8, 9, 11, 6 )
                        iMesh.Faces.AddFace( 9, 10, 11 )
                        #iMesh.Faces.AddFace(3, 2, 1, 4)
                        #iMesh.Faces.AddFace( 5, 6, 11, 0 )
                        #iMesh.Faces.AddFace(7, 8, 9, 10)
                        iMesh.VertexColors.CreateMonotoneMesh( colour )
                        meshExtr.Append( iMesh ) 
                elif  dimSection[0] == 'rectangularHollow' : 
                    sectionForm1 = [row[0] for row in sectionForm ]
                    sectionForm2 = [row[1] for row in sectionForm ]
                    meshExtr = meshLoft3( sectionForm1,  color )
                    meshExtr.Append( meshLoft3( sectionForm2,  color ) )
                    sectionStartEnd = [ [sectionForm1[0], sectionForm2[0]], [sectionForm1[-1], sectionForm2[-1]]  ]
                    for iSection in sectionStartEnd :
                        iMesh = rg.Mesh()
                        for iPoint, jPoint in zip(iSection[0],iSection[1])  :
                            iMesh.Vertices.Add( iPoint )
                            iMesh.Vertices.Add( jPoint )
                        iMesh.Faces.AddFace(0, 1, 3, 2)
                        iMesh.Faces.AddFace(2, 3, 5, 4)
                        iMesh.Faces.AddFace(4, 5, 7, 6)
                        iMesh.Faces.AddFace(6, 7, 1, 0)
                        iMesh.VertexColors.CreateMonotoneMesh( colour )
                        meshExtr.Append( iMesh )
                        #meshExtr.IsClosed()
            
                elif dimSection[0] == 'Generic' :
                    meshExtr = meshLoft3( sectionForm,  color )
            
                return [ line, meshExtr, colour ]
            
            def meshLoft3( point, color ):
                #print( point )
                meshEle = rg.Mesh()
                pointSection1 = point
                for i in range(0,len(pointSection1)):
                    for j in range(0, len(pointSection1[0])):
                        vertix = pointSection1[i][j]
                        #print( type(vertix) )
                        meshEle.Vertices.Add( vertix ) 
                        #meshEle.VertexColors.Add( color[0],color[1],color[2] );
                k = len(pointSection1[0])
                for i in range(0,len(pointSection1)-1):
                    for j in range(0, len(pointSection1[0])):
                        if j < k-1:
                            index1 = i*k + j
                            index2 = (i+1)*k + j
                            index3 = index2 + 1
                            index4 = index1 + 1
                        elif j == k-1:
                            index1 = i*k + j
                            index2 = (i+1)*k + j
                            index3 = (i+1)*k
                            index4 = i*k
                        meshEle.Faces.AddFace(index1, index2, index3, index4)
                        #rs.ObjectColor(scyl,(255,0,0))
                colour = rs.CreateColor( color[0], color[1], color[2] )
                meshEle.VertexColors.CreateMonotoneMesh( colour )
                meshElement = meshEle
                
                return meshElement
            
            def AddBoxFromCenter(plane, width, height):
                a = plane.PointAt(-width * 0.5, -width * 0.5 )
                b = plane.PointAt(-width * 0.5,  width * 0.5 )
                c = plane.PointAt( width * 0.5,  width * 0.5 )
                d = plane.PointAt( width * 0.5,  -width * 0.5 )
                rectangle1 = rg.Brep.CreateFromCornerPoints( a, b, c, d, 0.01)
                box = rg.Brep.CreateOffsetBrep( rectangle1, height, True, True, 0.01 )
                return box
            
            def AddForm1Center(plane, width, height):
                surf = rg.Brep()
                a = plane.PointAt(-width * 0.25, -width * 0.25 )
                b = plane.PointAt(-width * 0.25,  width * 0.25 )
                c = plane.PointAt( width * 0.25,  width * 0.25 )
                d = plane.PointAt( width * 0.25,  -width * 0.25 )
                rectangle1 = rg.Brep.CreateFromCornerPoints( a, b, c, d, 0.01)
                rectangleCurve1 = rg.PolylineCurve( [ a, b, c, d, a] )
                e = plane.PointAt(-width * 0.5, -width * 0.5 )
                f = plane.PointAt(-width * 0.5,  width * 0.5 )
                g = plane.PointAt( width * 0.5,  width * 0.5 )
                h = plane.PointAt( width * 0.5,  -width * 0.5 )
                rectangle2 = rg.Brep.CreateFromCornerPoints( e, f, g, h, 0.01)
                rectangleCurve2 = rg.PolylineCurve( [ e, f, g, h, e] )
                vectorMove = rg.Vector3d( 0, 0, -height )
                trasl = rg.Transform.Translation( vectorMove )
                rectangle2.Transform( trasl )
                rectangleCurve2.Transform( trasl )
                surf.Append( rectangle1 )
                surf.Append( rectangle2 )
                pyramidTrunk = rg.Brep.CreateFromLoft( [ rectangleCurve1, rectangleCurve2 ], rg.Point3d.Unset, rg.Point3d.Unset, rg.LoftType.Straight, False )
                for pyramid in pyramidTrunk:
                    surf.Append( pyramid )
                return  surf 
            
            def AddForm2Center(plane, width, height):
                surf = rg.Brep()
                a = plane.PointAt(-width * 0.5, -width * 0.25 )
                b = plane.PointAt(-width * 0.5,  width * 0.25 )
                c = plane.PointAt( width * 0.5,  width * 0.25 )
                d = plane.PointAt( width * 0.5,  -width * 0.25 )
                rectangle1 = rg.Brep.CreateFromCornerPoints( a, b, c, d, 0.01)
                rectangleCurve1 = rg.PolylineCurve( [ a, b, c, d, a] )
                e = plane.PointAt(-width * 0.5, -width * 0.5 )
                f = plane.PointAt(-width * 0.5,  width * 0.5 )
                g = plane.PointAt( width * 0.5,  width * 0.5 )
                h = plane.PointAt( width * 0.5,  -width * 0.5 )
                rectangle2 = rg.Brep.CreateFromCornerPoints( a, b, c, d, 0.01)
                rectangleCurve2 = rg.PolylineCurve( [ e, f, g, h, e] )
                vectorMove = rg.Vector3d( 0, 0, -height )
                trasl = rg.Transform.Translation( vectorMove )
                rectangle2.Transform( trasl )
                rectangleCurve2.Transform( trasl )
                surf.Append( rectangle1 )
                surf.Append( rectangle2 )
                pyramidTrunk = rg.Brep.CreateFromLoft( [ rectangleCurve1, rectangleCurve2 ], rg.Point3d.Unset, rg.Point3d.Unset, rg.LoftType.Straight, False )
                for pyramid in pyramidTrunk:
                    surf.Append( pyramid )
                return  surf 
            
            def AddForm3Center(plane, width, height):
                surf = rg.Brep()
                a = plane.PointAt(-width * 0.25, -width * 0.5 )
                b = plane.PointAt(-width * 0.25,  width * 0.5 )
                c = plane.PointAt( width * 0.25,  width * 0.5 )
                d = plane.PointAt( width * 0.25,  -width * 0.5 )
                rectangle1 = rg.Brep.CreateFromCornerPoints( a, b, c, d, 0.01)
                rectangleCurve1 = rg.PolylineCurve( [ a, b, c, d, a] )
                e = plane.PointAt(-width * 0.5, -width * 0.5 )
                f = plane.PointAt(-width * 0.5,  width * 0.5 )
                g = plane.PointAt( width * 0.5,  width * 0.5 )
                h = plane.PointAt( width * 0.5,  -width * 0.5 )
                rectangle2 = rg.Brep.CreateFromCornerPoints( a, b, c, d, 0.01)
                rectangleCurve2 = rg.PolylineCurve( [ e, f, g, h, e] )
                vectorMove = rg.Vector3d( 0, 0, -height )
                trasl = rg.Transform.Translation( vectorMove )
                rectangle2.Transform( trasl )
                rectangleCurve2.Transform( trasl )
                surf.Append( rectangle1 )
                surf.Append( rectangle2 )
                pyramidTrunk = rg.Brep.CreateFromLoft( [ rectangleCurve1, rectangleCurve2 ], rg.Point3d.Unset, rg.Point3d.Unset, rg.LoftType.Straight, False )
                for pyramid in pyramidTrunk:
                    surf.Append( pyramid )
                return  surf 
            
            
            #---------------------------------------------------------------------------------------#
            
            
            nodeWrapper = AlpacaModel[0]
            GeomTransf = AlpacaModel[1]
            openSeesBeam = AlpacaModel[2]
            openSeesSupport = AlpacaModel[3]
            openSeesNodeLoad = AlpacaModel[4]
            openSeesNodalMass = AlpacaModel[5]
            openSeesBeamLoad = AlpacaModel[6]
            openSeesShell = AlpacaModel[8]
            openSeesSolid = AlpacaModel[10]
            
            
            
            #######
            ####### NodeTag
            #######
            
            pointWrapper = []
            for item in nodeWrapper:
                point = rg.Point3d(item[1],item[2],item[3])
                pointWrapper.append( [item[0], point ] )
            
            ## Dict. for point ##
            pointWrapperDict = dict( pointWrapper )
            
            posTag = [row[1] for row in pointWrapper ]
            nodeTag = [row[0] for row in pointWrapper ]
            
            """
            if NodeTag:
                self.posTag = posTag
                self.nodeTag = nodeTag
                cameraX = sc.doc.Views.ActiveView.ActiveViewport.CameraX
                cameraY = sc.doc.Views.ActiveView.ActiveViewport.CameraY
                for pos, index in zip(posTag, nodeTag):
                    cd.AddText( rc.Display.Text3d( str(index) , rc.Geometry.Plane(pos, cameraX, cameraY) , 0.3 )    ,  System.Drawing.Color.Black)
            """
            
            model = []
            extrudedModel = []
            line = []
            colorLine = []
            shellVisualise = []
            
            eleTag = []
            posEleTag = []
            for ele in openSeesBeam :
                eleTag.append(ele[1])
                beamModel = Beam( ele, pointWrapperDict )
                line.append( beamModel[0] )
                posEleTag.append( beamModel[0].PointAtNormalizedLength(0.5) )
                colorLine.append( beamModel[2] )
                model.append([ ele[1], beamModel[0] ])
                extrudedModel.append([ ele[1], beamModel[1] ])
            
            for ele in openSeesShell :
                nNode = len( ele[2] )
                eleTag.append( ele[1] )
                if nNode == 4 :
                    shellModel = ShellQuad( ele, pointWrapperDict )
                    calcPropSection = rg.AreaMassProperties.Compute( shellModel[0], False, True, False, False )
                    centroid = calcPropSection.Centroid
                    posEleTag.append( centroid )
                elif nNode == 3:
                    #print( nNode )
                    shellModel = ShellTriangle( ele, pointWrapperDict )
                    calcPropSection = rg.AreaMassProperties.Compute( shellModel[0], False, True, False, False )
                    centroid = calcPropSection.Centroid
                    posEleTag.append( centroid )
                
                shellVisualise.append(shellModel[0])
                model.append([ ele[1] ,shellModel[0] ])
                extrudedModel.append([ ele[1],shellModel[1] ])
            
            
            
            brickVisualise = []
            for ele in openSeesSolid :
                nNode = len( ele[2] )
                eleTag.append( ele[1] )
                eleType = ele[0] 
                if nNode == 8:
                    solidModel = Solid( ele, pointWrapperDict )
                    calcPropSection = rg.AreaMassProperties.Compute( solidModel, False, True, False, False )
                    centroid = calcPropSection.Centroid
                    posEleTag.append( centroid )
                elif  eleType == 'FourNodeTetrahedron' :
                    #print(ele)
                    solidModel = TetraSolid( ele, pointWrapperDict )
                    calcPropSection = rg.AreaMassProperties.Compute( solidModel, False, True, False, False )
                    centroid = calcPropSection.Centroid
                    posEleTag.append( centroid )
                brickVisualise.append(solidModel)
            
                model.append([ ele[1], solidModel ])
                extrudedModel.append([ ele[1], solidModel ])
            
            
            
            #######
            ####### ElementTag
            #######
            
            
            tagEle = th.list_to_tree( [ posEleTag, eleTag ]  )
            """
            if ElementTag:
                for pos, index in zip(posEleTag, eleTag):
                    cameraX = sc.doc.Views.ActiveView.ActiveViewport.CameraX
                    cameraY = sc.doc.Views.ActiveView.ActiveViewport.CameraY
                    cd.AddText( rc.Display.Text3d( str(index) , rc.Geometry.Plane(pos, cameraX, cameraY)  , 0.3 )    ,  System.Drawing.Color.Red)
            """
            
            # --------------------------------#
            modelDict = dict( model )
            modelExstrudedDict = dict( extrudedModel )
            ModelView = []
            ModelViewExtruded = []
            for i in range(0,len(modelDict)):
                ModelView.append( modelDict.get( i  , "never" ))
                ModelViewExtruded.append( modelExstrudedDict.get( i , "never" ))
            
            #--------------------------------#
            
            
            lineModel = th.list_to_tree( [ line, colorLine ]  )
            
            #######
            ####### LocalAxis
            #######
            
            
            midPoint = []
            v3Display = []
            v2Display = []
            v1Display = []
            versorLine = []
            
            for ele in openSeesBeam :
                tag = ele[1]
                indexStart = ele[2][0]
                indexEnd = ele[2][1]
                propSection = ele[13]
                ## creo la linea ##
                lineAxis = rg.LineCurve( pointWrapperDict.get( indexStart  , "never"), pointWrapperDict.get( indexEnd  , "never"))
                MidPoint =  lineAxis.PointAtNormalizedLength(0.5)
                ## creo i versori  ##
                axis1 =  rg.Vector3d( ele[13][0][0], ele[13][0][1], ele[13][0][2]  )
                axis2 =  rg.Vector3d( ele[13][1][0], ele[13][1][1], ele[13][1][2]  )
                axis3 =  rg.Vector3d( ele[13][2][0], ele[13][2][1], ele[13][2][2]  )
                versor = [ axis1, axis2, axis3 ] 
                versorLine.append( [ tag ,versor ]  )
                midPoint.append( MidPoint )
                v3Display.append( axis3 )
                v2Display.append( axis2  )
                v1Display.append( axis1  )
            
            
            VersorLine = dict( versorLine )
            
            
            if LocalAxis:
                self.midPoint = midPoint
                self.v1Display = v1Display
                self.v2Display = v2Display
                self.v3Display = v3Display
            else:
                self.midPoint = []
                self.v1Display = []
                self.v2Display = []
                self.v3Display = []
            
            #######
            ####### Force
            #######
            
            forceMax = []
            for force in openSeesNodeLoad :
                forceVector =  rg.Vector3d( force[1][0], force[1][1] , force[1][2]  )
                fmax = max( forceVector.X, forceVector.Y, forceVector.Z )
                fmin = min( forceVector.X, forceVector.Y, forceVector.Z )
                forceMax.append( max( [ fmax, mt.fabs(fmin) ] ) )
            
            
            for linearLoad in openSeesBeamLoad :
                forceVector =  rg.Vector3d( linearLoad[1][0], linearLoad[1][1] , linearLoad[1][2]  )
                fmax = max( forceVector.X, forceVector.Y, forceVector.Z )
                fmin = min( forceVector.X, forceVector.Y, forceVector.Z )
                forceMax.append( max( [ fmax, mt.fabs(fmin) ] ) )
            
            #print( forceMax )
            forceMin = min( forceMax )
            
            
            #scale = forceMax*0.1/coordMax 
            if forceMin > 0 :
                scale = 1/forceMin 
            else :
                scale = 0.2
            
            forceDisplay = []
            ancorPoint = []
            
            for force in openSeesNodeLoad :
                index = force[0]
                pos = pointWrapperDict.get( index  , "never") 
                forceVector =  rg.Vector3d( force[1][0], force[1][1] , force[1][2]  )
                ancorPoint.append( pos )
                forceDisplay.append(  forceVector*scale  )
                
            for linearLoad in openSeesBeamLoad :
                tag =  linearLoad[0]
                geomTransf = VersorLine.get( tag  , "never" )
                force1 = rg.Vector3d.Multiply( linearLoad[1][0], geomTransf[0] )
                force2 = rg.Vector3d.Multiply( linearLoad[1][1], geomTransf[1] )
                force3 = rg.Vector3d.Multiply( linearLoad[1][2], geomTransf[2] )
                forceVector =  rg.Vector3d.Multiply( force1 + force2 + force3, scale )
                lineBeam =  modelDict.get( tag  , "never" )
                Length = rg.Curve.GetLength( lineBeam )
                divideDistance = 0.5
                DivCurve = lineBeam.DivideByLength( divideDistance, True )
                if DivCurve == None:
                    DivCurve = [ 0, Length]
            
                for index, x in enumerate(DivCurve):
                    beamPoint = lineBeam.PointAt(DivCurve[index]) 
                    ancorPoint.append( beamPoint )
                    forceDisplay.append( forceVector )
                
            #######
            ####### Mass
            #######
            
            if len(openSeesNodalMass)>0:
                scaleMass  = max([row[1][0] for row in openSeesNodalMass ])
            else:
                scaleMass = 0
            if scaleMass > 0 :
                scaleMass = scaleMass
            else :
                scaleMass = 1
            
            massPos = []
            massValue = []
            for mass in openSeesNodalMass  :
                index  = mass[0]
                massPos.append(pointWrapperDict.get( index  , "never"))
                massValue.append(mass[1][0]/scaleMass)
            
            Mass = th.list_to_tree( [ massPos , massValue ] )
            
            #######
            #######Support
            #######
            
            supportBrep = []
            
            for support in openSeesSupport :
                index = support[0]
                pos = pointWrapperDict.get( index  , "never")
                center_point = rg.Point3d( pos )
                
                if support[1] == 1 and support[2] == 0 and support[3] == 1 and support[4] == 1 and support[5] == 1 and support[6] == 1 : # carrello lungo y
                    supp = rg.Brep()
                    plane = rg.Plane.WorldYZ
                    radius = 0.15
                    length = radius*3.50
                    vector = rg.Vector3d( -length/2, 0 , -2.5*radius ) 
                    vectorTrasl = rg.Point3d.Add( center_point, vector )
                    trasl = rg.Transform.Translation( vectorTrasl.X, vectorTrasl.Y, vectorTrasl.Z ) 
                    plane.Transform( trasl )
                    circle = rg.Circle(plane, radius/2)
                    brepCylinder = rg.Brep.CreateFromCylinder( rg.Cylinder(circle, length), True, True )
                    cylinder1 = rg.Brep.DuplicateBrep(brepCylinder)
                    traslc1 = rg.Transform.Translation( 0, -length/4, 0 )
                    cylinder1.Transform( traslc1 )
                    cylinder2 = rg.Brep.DuplicateBrep(brepCylinder)
                    supp.Append( cylinder1 )
                    traslc2 = rg.Transform.Translation( 0, length/4, 0 )
                    cylinder2.Transform( traslc2 )
                    supp.Append( cylinder2 )
                    plane2 = rg.Plane.WorldXY
                    vector2 = rg.Vector3d( 0, 0 , 0 ) 
                    vectorTrasl2 = rg.Point3d.Add( center_point, vector2 )
                    trasl2 = rg.Transform.Translation( vectorTrasl2.X, vectorTrasl2.Y, vectorTrasl2.Z ) 
                    plane2.Transform( trasl2 )
                    supp.Append( AddForm2Center(plane2, length, radius*2) )
                    supportBrep.append( supp )
                if support[1] == 0 and support[2] == 1 and support[3] == 1 and support[4] == 1 and support[5] == 1 and support[6] == 1 : # carrello lungo x
                    supp = rg.Brep()
                    plane = rg.Plane.WorldZX
                    radius = 0.15
                    length = radius*3.50
                    vector = rg.Vector3d( 0, -length/2 , -2.5*radius ) 
                    vectorTrasl = rg.Point3d.Add( center_point, vector )
                    trasl = rg.Transform.Translation( vectorTrasl.X, vectorTrasl.Y, vectorTrasl.Z ) 
                    plane.Transform( trasl )
                    circle = rg.Circle(plane, radius/2)
                    brepCylinder = rg.Brep.CreateFromCylinder( rg.Cylinder(circle, length), True, True ) 
                    cylinder1 = rg.Brep.DuplicateBrep(brepCylinder)
                    traslc1 = rg.Transform.Translation( -length/4, 0, 0 )
                    cylinder1.Transform( traslc1 )
                    cylinder2 = rg.Brep.DuplicateBrep(brepCylinder)
                    supp.Append( cylinder1 )
                    traslc2 = rg.Transform.Translation( length/4, 0, 0 )
                    cylinder2.Transform( traslc2 )
                    supp.Append( cylinder2 )
                    plane2 = rg.Plane.WorldXY
                    vector2 = rg.Vector3d( 0, 0 , 0 )
                    vectorTrasl2 = rg.Point3d.Add( center_point, vector2 )
                    trasl2 = rg.Transform.Translation( vectorTrasl2.X, vectorTrasl2.Y, vectorTrasl2.Z ) 
                    plane2.Transform( trasl2 )
                    supp.Append( AddForm3Center(plane2, length, radius*2) )
                    supportBrep.append( supp )
                if support[1] == 1 and support[2] == 1 and support[3] == 1 and support[4] == 0 and support[5] == 1  : # cerniera lungo x
                    supp = rg.Brep()
                    plane = rg.Plane.WorldYZ
                    radius = 0.15
                    length = radius*3.50
                    vector = rg.Vector3d( -length/2, 0 , -radius )
                    vectorTrasl = rg.Point3d.Add( center_point, vector )
                    trasl = rg.Transform.Translation( vectorTrasl.X, vectorTrasl.Y, vectorTrasl.Z ) 
                    plane.Transform( trasl )
                    circle = rg.Circle(plane, radius)
                    supp.Append( rg.Brep.CreateFromCylinder( rg.Cylinder(circle, length), True, True ) )
                    plane2 = rg.Plane.WorldXY
                    vector2 = rg.Vector3d( 0, 0 , -1.70*radius )
                    vectorTrasl2 = rg.Point3d.Add( center_point, vector2 )
                    trasl2 = rg.Transform.Translation( vectorTrasl2.X, vectorTrasl2.Y, vectorTrasl2.Z ) 
                    plane2.Transform( trasl2 )
                    supp.Append( AddForm2Center(plane2, length, radius*2) )
                    supportBrep.append( supp )
                if support[1] == 1 and support[2] == 1 and support[3] == 1 and support[4] == 1 and support[5] == 0  : # cerniera lungo y
                    supp = rg.Brep()
                    plane = rg.Plane.WorldZX
                    radius = 0.15
                    length = radius*3.50
                    vector = rg.Vector3d( 0, -length/2 , -radius ) 
                    vectorTrasl = rg.Point3d.Add( center_point, vector )
                    trasl = rg.Transform.Translation( vectorTrasl.X, vectorTrasl.Y, vectorTrasl.Z ) 
                    plane.Transform( trasl )
                    circle = rg.Circle(plane, radius)
                    supp.Append( rg.Brep.CreateFromCylinder( rg.Cylinder(circle, length), True, True ) )
                    plane2 = rg.Plane.WorldXY
                    vector2 = rg.Vector3d( 0, 0 , -1.70*radius )
                    vectorTrasl2 = rg.Point3d.Add( center_point, vector2 )
                    trasl2 = rg.Transform.Translation( vectorTrasl2.X, vectorTrasl2.Y, vectorTrasl2.Z ) 
                    plane2.Transform( trasl2 )
                    supp.Append( AddForm3Center(plane2, length, radius*2) )
                    supportBrep.append( supp )
                if support[1] == 1 and support[2] == 1 and support[3] == 1 and support[4] == 0 and support[5] == 0   : # cerniera sferica
                    radius = 0.15
                    length = radius*3.50
                    vector = rg.Vector3d( 0, 0 , -radius ) 
                    center =  rg.Point3d.Add( center_point, vector )
                    supp = rg.Brep()
                    # sfera
                    supp.Append( rg.Brep.CreateFromSphere(rg.Sphere( center, radius)))
                    plane = rg.Plane.WorldXY
                    vectorTrasl = rg.Point3d.Add( center_point, 1.70*vector )
                    trasl = rg.Transform.Translation( vectorTrasl.X, vectorTrasl.Y, vectorTrasl.Z  )
                    plane.Transform( trasl )
                    # tronco di piramide
                    supp.Append( AddForm1Center(plane, length, radius*2) )
                    supportBrep.append( supp )
                if support[1] == 1 and support[2] == 1 and support[3] == 1 and support[4] == 1 and support[5] == 1  and support[6] == 1 : # incastro
                    plane = rg.Plane.WorldXY
                    length = 0.5
                    h = length/3
                    vector = rg.Vector3d( 0, 0 , 0 )
                    vectorTrasl = rg.Point3d.Add( center_point, vector )
                    trasl = rg.Transform.Translation( vectorTrasl.X, vectorTrasl.Y, vectorTrasl.Z  )
                    plane2 = rg.Plane.Clone( plane )
                    plane2.Transform( trasl )
                    supp = AddBoxFromCenter(plane2, length, h)[0]
                    supportBrep.append( supp[0] )

            if Model == True:
                self.line = line
                self.colorLine = colorLine
            else:
                self.line = []
                self.colorLine = []

            if Load == True:
                self.ancorPoint = ancorPoint
                self.forceDisplay = forceDisplay
            else:
                self.ancorPoint = []
                self.forceDisplay = []

            if NodeTag == True:
                self.posTag = posTag
                self.nodeTag = nodeTag
            else:
                self.posTag = []
                self.nodeTag = []

            if ElementTag == True:
                self.posEleTag = posEleTag
                self.eleTag = eleTag
            else:
                self.posEleTag = []
                self.eleTag = []

            if Support == True:
                self.supportBrep = supportBrep
                self.material = rc.Display.DisplayMaterial(System.Drawing.Color.Cyan, 0.0)
            else:
                self.supportBrep = []
                self.material = []
                
            
            if Model == True:
                return AlpacaModel, ModelView
            else:
                return AlpacaModel, ModelViewExtruded
            #return AlpacaModel, ModelView
            
        checkData = True
        
        if not AlpacaModel:
            checkData = False
            msg = "input 'AlpacaModel' failed to collect data"
            ghenv.Component.AddRuntimeMessage(gh.Kernel.GH_RuntimeMessageLevel.Warning, msg)
        
        if checkData != False:
            AlpacaModel, Model = VisualiseModel(AlpacaModel, Model, Support, Mass, LocalAxis, Load, NodeTag, ElementTag)
            return AlpacaModel, Model


    def DrawViewportWires(self,arg):
        
        for crv, color in zip(self.line, self.colorLine):
            arg.Display.DrawCurve(crv, color, 4)
        
        for ancor, force in zip(self.ancorPoint, self.forceDisplay):
            arg.Display.DrawMarker(ancor, force, System.Drawing.Color.Black)
        
        for pos, tag in zip(self.posTag, self.nodeTag):
            arg.Display.Draw2dText(str(tag), System.Drawing.Color.Blue, pos, True, 20)
        
        for pos, tag in zip(self.posEleTag, self.eleTag):
            arg.Display.Draw2dText(str(tag), System.Drawing.Color.Red, pos, True, 20)
        
        for midPoint, axis1, axis2, axis3 in zip( self.midPoint, self.v1Display, self.v2Display, self.v3Display):
            arg.Display.DrawLine( midPoint, midPoint + axis1, System.Drawing.Color.Red, 3 )
            arg.Display.DrawLine( midPoint, midPoint + axis2, System.Drawing.Color.Green, 3 )
            arg.Display.DrawLine( midPoint, midPoint + axis3, System.Drawing.Color.Blue, 3 )
            
        for brep in self.supportBrep:
            arg.Display.DrawBrepShaded(brep,self.material)
# ---------- end python_20 ----------
geometry = Geometry(python_20.Model)

data_15 = Data(python_19.AlpacaModel)  # disabled
data_16 = Data(python_19.AlpacaModel)
panel_12 = Panel("1.25")  # disabled
panel_13 = Panel("0.15")  # disabled
panel_14 = Panel("2.4")  # disabled
panel_15 = Panel("0.5")  # disabled

# ----
# Modal Analyses
path_3 = FilePath("C:\GitHub\Alpaca4d\PythonScript\Analyses\DynamicAnalysis\initializeModalAnalyses.py")
file_3 = ReadFile(File=path_3, PerLineParse=False)
analyze_2 = GhPythonScript(Code=file_3, AlpacaModel=data_16, NumVibrationModes="3")  # -> Out, AlpacaModalOutput, Frequency, Period, MassPart; disabled

panel_16 = Panel("2.25")  # disabled

# ----
# LinearDinamicForce
panel_17 = Panel("2.0")  # disabled
panel_18 = Panel("5.88")  # disabled
path_4 = FilePath("C:\GitHub\Alpaca4d\PythonScript\Analyses\LinearDynamicAnalysis\initializeLinearDynamicAnalyses.py")  # disabled
file_4 = ReadFile(File=path_4, PerLineParse=False)  # disabled
analyze_3 = GhPythonScript(
    Code=file_4,
    AlpacaModel=data_15,
    NumVibrationModes="3",
    Ag=panel_16,
    F0=panel_14,
    S=panel_12,
    Tb=panel_13,
    Tc=panel_15,
    Td=panel_17,
    Q=panel_18)  # -> Frequency, Period, MassPart, Spectrum, PossNodeForce, ForceX, ForceY; disabled

number_slider_2 = Slider(167, range=0..1000)  # disabled
panel_19 = Panel(analyze_2.MassPart)
merge_2 = Merge(Data1=analyze.AlpacaStaticOutput)  # -> flatten(Result); disabled
panel_20 = Panel(analyze_3.MassPart)  # disabled
quick_graph = QuickGraph(analyze_3.Spectrum, SortOrder=0)  # disabled
cluster = Cluster_2(A=analyze_3.PossNodeForce, x_component=0, y_component=analyze_3.ForceY, B=number_slider_2)  # disabled
cluster_2 = Cluster_2(A=analyze_3.PossNodeForce, x_component=analyze_3.ForceX, y_component=0, B=number_slider_2)  # disabled

# ---- group: Beam Forces
# CDS valor
number_slider_3 = Slider(10, range=0..10)  # disabled
file_path_14 = FilePath("C:\GitHub\Alpaca4d\PythonScript\Post-Processing\beamForces\beamForces.py")  # disabled
# beam Component
read_file_14 = ReadFile(File=file_path_14, PerLineParse=False)  # disabled
python_21 = GhPythonScript(Code=read_file_14, AlpacaStaticOutput=analyze.AlpacaStaticOutput)  # -> Out, TagElement, N, V1, V2, Mt, M1, M2; disabled

# ---- group: Reaction Forces
# Reactions
number_slider_4 = Slider(2.28, range=0..10)
python_22 = GhPythonScript(
    AlpacaStaticOutput=analyze.AlpacaStaticOutput,
    reactionForcesView=Toggle(False),
    reactionMomentsView=Toggle(False),
    scale=number_slider_4)  # -> tagPoints, ReactionForce, ReactionMoment; inputs AlpacaStaticOutput: list, reactionForcesView: Boolean, reactionMomentsView: Boolean
# ---------- python_22: Python ----------
"""Compute the Reaction Forces
            Inputs:
                AlpacaStaticOutput: Output of static Analyses Solver.
                reactionForcesView : True - view reaction Forces.
                reactionMomentsView : True - view reaction Moments.
                scale: number that multiplies the reaction.
            Output:
               tagPoints :  nodes tag of Model.
               ReactionForce : Vector of reaction Forces { Rx, Ry, Rz }.
               ReactionMoment : Vector of reaction Moments { Mx, My, Mz }.
"""


from ghpythonlib.componentbase import executingcomponent as component
import Grasshopper, GhPython
import System
import Rhino
import rhinoscriptsyntax as rs
import Rhino.Geometry as rg

class MyComponent(component):
    
    def RunScript(self, AlpacaStaticOutput, reactionForcesView, reactionMomentsView, scale):
        
        import Rhino.Geometry as rg
        import math
        import ghpythonlib.treehelpers as th # per data tree
        import Grasshopper as gh
        import sys
        
        
        
        #---------------------------------------------------------------------------------------#
        def reaction(AlpacaStaticOutput, scale, reactionForceView = False, reactionMomentsView = False):
        
            # define output
        
            global tagPoints
            global ReactionForce
            global ReactionMoment
            global view
        
            reactionForceView = False if reactionForceView is None else reactionForceView
            reactionMomentsView = False if reactionMomentsView is None else reactionMomentsView
        
            if scale is None :
                scale = 1
        
        
            diplacementWrapper = AlpacaStaticOutput[0]
            reactionOut = AlpacaStaticOutput[1]
            #print( len( reactionOut ) )
        
            pointWrapper = []
        
            for index,item in enumerate(diplacementWrapper):
                pointWrapper.append( [index, rg.Point3d(item[0][0],item[0][1],item[0][2]) ] )
        
            ## Dict. for point ##
            pointWrapperDict = dict( pointWrapper )
        
            ## per scalare le reazioni #
            rowReaction = [row[1] for row in reactionOut ]
        
            valorReaction = []
            for valor in rowReaction:
                rx = math.fabs( valor[0] )
                ry = math.fabs( valor[1] )
                rz = math.fabs( valor[2] )
                mx = math.fabs( valor[3] )
                my = math.fabs( valor[4] )
                mz = math.fabs( valor[5] )
                valorReaction.append( [ rx, ry, rz, mx, my, mz ] )
        
            rx = max([row[0] for row in valorReaction ])
            ry = max([row[1] for row in valorReaction ])
            rz = max([row[2] for row in valorReaction ])
            mx = max([row[3] for row in valorReaction ])
            my = max([row[4] for row in valorReaction ])
            mz = max([row[5] for row in valorReaction ])
            # -------------------------------------------------------#
        
            ReactionForce = []
            ReactionMoment = []
            viewElement = []
            tagPoints = []
            for value in reactionOut:
                pointIndex = value[0]
                tagPoints.append( pointIndex )
                point = pointWrapperDict.get( pointIndex , "never")
                Rx = rg.Vector3d( value[1][0], 0, 0 )
                Ry = rg.Vector3d( 0,value[1][1], 0 )
                Rz = rg.Vector3d( 0,0, value[1][2] )
                Mx = rg.Vector3d( value[1][3], 0, 0 )
                My = rg.Vector3d( 0, value[1][4], 0 )
                Mz = rg.Vector3d( 0,0, value[1][5] )
                Rxyz = Rx + Ry + Rz
                Mxyz = Mx + My + Mz
                viewElement.append( [ point, Rx/rx*scale, Ry/ry*scale, Rz/rz*scale, Mx/mx*scale, My/my*scale, Mz/mz*scale ] )
                ReactionForce.append( Rxyz )
                ReactionMoment.append( Mxyz )
        
            point = [row[0] for row in viewElement ]
            Rx = [row[1] for row in viewElement ]
            Ry = [row[2] for row in viewElement ]
            Rz = [row[3] for row in viewElement ]
            Mx = [row[4] for row in viewElement ]
            My = [row[5] for row in viewElement ]
            Mz = [row[6] for row in viewElement ]
            
            
            self.point = point if reactionForcesView or reactionMomentsView == True else []
            self.Rx = Rx if reactionForcesView == True else []
            self.Ry = Ry if reactionForcesView == True else []
            self.Rz = Rz if reactionForcesView == True else []
            self.Mx = Mx if reactionMomentsView == True else []
            self.My = My if reactionMomentsView == True else []
            self.Mz = Mz if reactionMomentsView == True else []
            
            null = [rg.Vector3d( 0, 0, 0 )]*len(Rx)
        
            if reactionForcesView == True and reactionMomentsView == False or reactionForcesView == None and reactionMomentsView == False :
                view = th.list_to_tree( [ point, Rx, Ry, Rz, null, null, null ]  )
            elif reactionForcesView == False and reactionMomentsView == True or reactionForcesView == False and reactionMomentsView == None :
                view = th.list_to_tree( [ point, null, null, null, Mx, My, Mz ]   )
            elif reactionForcesView == True and reactionMomentsView == True or reactionForcesView == None and reactionMomentsView == None :
                view = th.list_to_tree( [ point, Rx, Ry, Rz,Mx, My, Mz ]  )
        
            return tagPoints, ReactionForce, ReactionMoment
        
        checkData = True
        
        if not AlpacaStaticOutput :
            checkData = False
            msg = "input 'AlpacaStaticOutput' failed to collect data"
            ghenv.Component.AddRuntimeMessage(gh.Kernel.GH_RuntimeMessageLevel.Warning, msg)
        
        if checkData != False :
            tagPoints, ReactionForce, ReactionMoments = reaction( AlpacaStaticOutput, scale, reactionForcesView, reactionMomentsView  )
            return (tagPoints, ReactionForce, ReactionMoment)

    def DrawViewportWires(self,arg):
        
        for ancor, forceX, forceY, forceZ in zip(self.point, self.Rx, self.Ry, self.Rz):
            arg.Display.DrawArrow( rg.Line(ancor, forceX) ,  System.Drawing.Color.Black)
            arg.Display.DrawArrow( rg.Line(ancor, forceY) ,  System.Drawing.Color.Black)
            arg.Display.DrawArrow( rg.Line(ancor, forceZ) ,  System.Drawing.Color.Black)
        
        for ancor, momentX, momentY, momentZ in zip(self.point, self.Mx, self.My, self.Mz):
            arg.Display.DrawArrow( rg.Line(ancor, momentX) ,  System.Drawing.Color.Red)
            arg.Display.DrawArrow( rg.Line(ancor, momentY) ,  System.Drawing.Color.Red)
            arg.Display.DrawArrow( rg.Line(ancor, momentZ) ,  System.Drawing.Color.Red)
# ---------- end python_22 ----------

# ---- group: shell Forces
# Forces valor
file_path_15 = FilePath("C:\GitHub\Alpaca4d\PythonScript\Post-Processing\shellForces\shellForces.py")
read_file_15 = ReadFile(File=file_path_15, PerLineParse=False)
python_23 = GhPythonScript(Code=read_file_15, AlpacaStaticOutput=analyze.AlpacaStaticOutput)  # -> Out, TagElement, Fx, Fy, Fz, Mx, My, Mz

# ----
# Brick component
# Stress view & valor
file_path_16 = FilePath("C:\GitHub\Alpaca4d\PythonScript\Post-Processing\brickStress\brickStress.py")
read_file_16 = ReadFile(File=file_path_16, PerLineParse=False)
list_2 = ValueList({"sigmaX": 0, "sigmaY": 1, "sigmaZ": 2, "tauXY": 3, "tauXZ": 4, "tauYZ": 5}, selected="tauYZ")
python_24 = GhPythonScript(Code=read_file_16, StressView=list_2)  # -> Brick, StressValue, DomainValues

# ---- group: nD Stress Visualisation / spectral
merge_3 = Merge(
    Data1=ColourSwatch(SwatchColor=RGB(201, 0, 0)),
    Data2=ColourSwatch(SwatchColor=RGB(240, 69, 7)),
    Data3=ColourSwatch(SwatchColor=RGB(251, 255, 0)),
    Data4=ColourSwatch(SwatchColor=RGB(77, 255, 0)),
    Data5=ColourSwatch(SwatchColor=RGB(0, 153, 28)),
    Data6=ColourSwatch(SwatchColor=RGB(67, 136, 247)),
    Data7=ColourSwatch(SwatchColor=RGB(0, 30, 255)),
    Data8=ColourSwatch(SwatchColor=RGB(111, 0, 176)))

# ----
# Forces view
file_path_17 = FilePath("C:\GitHub\Alpaca4d\PythonScript\Post-Processing\shellForceView\shellForceView.py")
read_file_17 = ReadFile(File=file_path_17, PerLineParse=False)
list_3 = ValueList({"Face1": 0, "Face2": 1, "Face3": 2, "Face4": 3}, selected="Face1")
list_4 = ValueList({"Fx": 0, "Fy": 1, "Fz": 2, "Mx": 3, "My": 4, "Mz": 5}, selected="Fx")
python_25 = GhPythonScript(Code=read_file_17, AlpacaStaticOutput=analyze.AlpacaStaticOutput, ViewForce=list_4, Face=list_3)  # -> Shell, ForceValue, DomainValues

# ---- group: Shell Stress Visualisation / spectral
merge_4 = Merge(
    Data1=ColourSwatch(SwatchColor=RGB(201, 0, 0)),
    Data2=ColourSwatch(SwatchColor=RGB(240, 69, 7)),
    Data3=ColourSwatch(SwatchColor=RGB(251, 255, 0)),
    Data4=ColourSwatch(SwatchColor=RGB(77, 255, 0)),
    Data5=ColourSwatch(SwatchColor=RGB(0, 153, 28)),
    Data6=ColourSwatch(SwatchColor=RGB(67, 136, 247)),
    Data7=ColourSwatch(SwatchColor=RGB(0, 30, 255)),
    Data8=ColourSwatch(SwatchColor=RGB(111, 0, 176)))

# ----
merge_5 = Merge(Data1=analyze.AlpacaStaticOutput)  # -> flatten(Result)

# ---- group: Shell Stress Visualisation
# Stress view & valor
file_path_18 = FilePath("C:\GitHub\Alpaca4d\PythonScript\Post-Processing\shellStressView\shellStressView.py")
read_file_18 = ReadFile(File=file_path_18, PerLineParse=False)
list_5 = ValueList({"pxx": 0, "pyy": 1, "pxy": 2, "txz": 3, "tyz": 4, "mxx": 5, "myy": 6, "mxy": 7}, selected="tyz")
python_26 = GhPythonScript(Code=read_file_18, AlpacaStaticOutput=analyze.AlpacaStaticOutput, StressView=list_5, ColorList=merge_4)  # -> Shell, StressValue, DomainValues

# ---- group: Cds Visualisation
# CDS view
file_path_19 = FilePath("C:\GitHub\Alpaca4d\PythonScript\Post-Processing\cdsView\cdsView.py")
read_file_19 = ReadFile(File=file_path_19, PerLineParse=False)
list_6 = ValueList({"N", "V1", "V2", "M2", "M1", "Mt"}, selected="M1")
python_27 = GhPythonScript(Code=read_file_19, AlpacaStaticOutput=analyze.AlpacaStaticOutput, SectionForces=list_6, Scale="0.001")

# ----
# Disp Numerical Ouput
# OK!
# Force component
number_slider_5 = Slider(10, range=0..10)  # disabled
file_path_20 = FilePath("C:\GitHub\Alpaca4d\PythonScript\Post-Processing\beamDisp\beamDisp.py")  # disabled
file_path_21 = FilePath("C:\GitHub\Alpaca4d\PythonScript\Post-Processing\brickDisp\brickDisp.py")  # disabled
file_path_22 = FilePath("C:\GitHub\Alpaca4d\PythonScript\Post-Processing\shellDisp\shellDisp.py")  # disabled
file_path_23 = FilePath("C:\GitHub\Alpaca4d\PythonScript\Post-Processing\nodalDisp\nodalDisp.py")  # disabled
read_file_20 = ReadFile(File=file_path_20, PerLineParse=False)  # disabled
read_file_21 = ReadFile(File=file_path_22, PerLineParse=False)  # disabled
read_file_22 = ReadFile(File=file_path_23, PerLineParse=False)  # disabled
read_file_23 = ReadFile(File=file_path_21, PerLineParse=False)  # disabled

# ---- group: jet
merge_6 = Merge(
    Data1=ColourSwatch(SwatchColor=RGB(201, 0, 0)),
    Data2=ColourSwatch(SwatchColor=RGB(255, 0, 0)),
    Data3=ColourSwatch(SwatchColor=RGB(240, 69, 7)),
    Data4=ColourSwatch(SwatchColor=RGB(251, 255, 0)),
    Data5=ColourSwatch(SwatchColor=RGB(77, 255, 0)),
    Data6=ColourSwatch(SwatchColor=RGB(0, 255, 221)),
    Data7=ColourSwatch(SwatchColor=RGB(0, 81, 255)))  # -> reverse(Result)

# ---- group: palette Perù
merge_7 = Merge(
    Data1=ColourSwatch(SwatchColor=RGB(209, 17, 17)),
    Data2=ColourSwatch(SwatchColor=RGB(235, 109, 63)),
    Data3=ColourSwatch(SwatchColor=RGB(158, 53, 219)),
    Data4=ColourSwatch(SwatchColor=RGB(173, 227, 48)),
    Data5=ColourSwatch(SwatchColor=RGB(67, 136, 247)),
    Data6=ColourSwatch(SwatchColor=RGB(0, 30, 255)))  # -> reverse(Result)

# ---- group: hsv
merge_8 = Merge(
    Data1=ColourSwatch(SwatchColor=RGB(240, 69, 7)),
    Data2=ColourSwatch(SwatchColor=RGB(251, 255, 0)),
    Data3=ColourSwatch(SwatchColor=RGB(77, 255, 0)),
    Data4=ColourSwatch(SwatchColor=RGB(0, 255, 221)),
    Data5=ColourSwatch(SwatchColor=RGB(67, 136, 247)),
    Data6=ColourSwatch(SwatchColor=RGB(0, 30, 255)),
    Data7=ColourSwatch(SwatchColor=RGB(135, 0, 176)),
    Data8=ColourSwatch(SwatchColor=RGB(247, 0, 103)))

# ----
# deformedModelView
# OK!
number_slider_6 = Slider(30, range=0..10000)
list_7 = ValueList({"tx": 0, "ty": 1, "tz": 2, "txyz": 3}, selected="txyz")
data_17 = Data(merge_5)
python_28 = GhPythonScript(AlpacaStaticOutput=data_17, scale=number_slider_6, modelExtrud=Toggle(True), direction=list_7, colorList=merge_6)  # -> modelDisp, domainValues; inputs AlpacaStaticOutput: list, modelExtrud: Boolean, direction: Int32, colorList: list of Color
# ---------- python_28: Python ----------
"""Generate Model view 
    Inputs:
        AlpacaStaticOutput: Output of solver on static Analyses.
        direction : view relative color of the traslation:
            '0' view traslation X.
            '1' view traslation Y.
            '2' view traslation Z.

        scale: number that multiplies the real displacements. 
        modelExtrud : 'True' = view exstrude model, 'False' = view analitic model. 

    Output:
       modelDisp: view deformed model :
       ModelCurve : analitic line ( polyline) of the beam or truss Element .
       max_min : max end min of displacement of the structure .
       """


from ghpythonlib.componentbase import executingcomponent as component
import Grasshopper, GhPython
import System
import Rhino
import rhinoscriptsyntax as rs

class MyComponent(component):
    
    def RunScript(self, AlpacaStaticOutput, scale, modelExtrud, direction, colorList):
        
        import Rhino as rc
        import Rhino.Geometry as rg
        import math
        import ghpythonlib.treehelpers as th # per data tree
        import Grasshopper as gh
        import sys
        import rhinoscriptsyntax as rs
        import Rhino.Display as rd
        from scriptcontext import sticky as st
        import System.Drawing.Color
        import scriptcontext as sc
        
        
        
        def alphat( E, G, I, At ):
            return (E*I)/(G*At)
        
        ## Spostamenti e rotazioni ##
        def spostu( x, L, uI, uJ ):
            return -(-L*uI + uI*x - uJ*x)/L
            
        def spostv( x, L, vI, vJ, thetaI, thetaJ, alphay ):
            return (L**3*thetaI*x + L**3*vI - 2*L**2*thetaI*x**2 - L**2*thetaJ*x**2 + 6*L*alphay*thetaI*x - 6*L*alphay*thetaJ*x + 12*L*alphay*vI + L*thetaI*x**3 + L*thetaJ*x**3 - 3*L*vI*x**2 + 3*L*vJ*x**2 - 6*alphay*thetaI*x**2 + 6*alphay*thetaJ*x**2 - 12*alphay*vI*x + 12*alphay*vJ*x + 2*vI*x**3 - 2*vJ*x**3)/(L*(L**2 + 12*alphay))
            
        def spostw( x, L, wI, wJ, psiI, psiJ, alphaz ):
            return -(L**3*psiI*x - L**3*wI - 2*L**2*psiI*x**2 - L**2*psiJ*x**2 - 6*L*alphaz*psiI*x + 6*L*alphaz*psiJ*x + 12*L*alphaz*wI + L*psiI*x**3 + L*psiJ*x**3 + 3*L*wI*x**2 - 3*L*wJ*x**2 + 6*alphaz*psiI*x**2 - 6*alphaz*psiJ*x**2 - 12*alphaz*wI*x + 12*alphaz*wJ*x - 2*wI*x**3 + 2*wJ*x**3)/(L*(L**2 - 12*alphaz))
            
        def thetaz(x, L, vI, vJ, thetaI, thetaJ, alphay): 
            return (L**3*thetaI - 4*L**2*thetaI*x - 2*L**2*thetaJ*x + 12*L*alphay*thetaI + 3*L*thetaI*x**2 + 3*L*thetaJ*x**2 - 6*L*vI*x + 6*L*vJ*x - 12*alphay*thetaI*x + 12*alphay*thetaJ*x + 6*vI*x**2 - 6*vJ*x**2)/(L*(L**2 + 12*alphay))
            
        def phix(x, L, phiI, phiJ):
            return -(-L*phiI + phiI*x - phiJ*x)/L
        
        def psiy(x, L, wI, wJ, psiI, psiJ, alphaz): 
            return (L**3*psiI - 4*L**2*psiI*x - 2*L**2*psiJ*x - 12*L*alphaz*psiI + 3*L*psiI*x**2 + 3*L*psiJ*x**2 + 6*L*wI*x - 6*L*wJ*x + 12*alphaz*psiI*x - 12*alphaz*psiJ*x - 6*wI*x**2 + 6*wJ*x**2)/(L*(L**2 - 12*alphaz))
            
        def gammay( L, vI, vJ, thetaI, thetaJ, alphay): 
        
            return (L*thetaI + L*thetaJ + 2*vI - 2*vJ)/(L*(L**2 + 12*alphay))
            
        def gammaz( L, wI, wJ, psiI, psiJ, alphaz):
        
            return -(L*psiI + L*psiJ - 2*wI + 2*wJ)/(L*(L**2 - 12*alphaz))
        
        ##------------------------------------------------------------------------- --##
        
        def scaleAutomatic( Num , Den ):
            if Den < 0.1 :
                return Num
            else :
                return Num*1/Den
        
        def linspace(a, b, n=100):
            if n < 2:
                return b
            diff = (float(b) - a)/(n - 1)
            return [diff * i + a  for i in range(n)]
        
        ## Funzione rettangolo ##
        def AddRectangleFromCenter(plane, width, height):
            a = plane.PointAt(-width * 0.5, -height * 0.5 )
            b = plane.PointAt(-width * 0.5,  height * 0.5 )
            c = plane.PointAt( width * 0.5,  height * 0.5 )
            d = plane.PointAt( width * 0.5,  -height * 0.5 )
            #rectangle = rg.PolylineCurve( [a, b, c, d, a] )
            rectangle  = [a, b, c, d] 
            return rectangle
            
        ## Funzione cerchio ##
        def AddCircleFromCenter( plane, radius):
            t = linspace( 0 , 1.80*math.pi, 16 )
            a = []
            for ti in t:
                x = radius*math.cos(ti)
                y = radius*math.sin(ti)
                a.append( plane.PointAt( x, y ) )
            #circle = rg.PolylineCurve( a )
            circle  = a 
            return circle
        
        def AddIFromCenter(plane, Bsup, tsup, Binf, tinf, H, ta, yg):
            #-------------------1---------2 #
            p1 = plane.PointAt( -(yg - tinf), ta/2 )
            p2 = plane.PointAt( -(yg - tinf), Binf/2 )
            p3 = plane.PointAt( -yg, Binf/2 )
            p4 = plane.PointAt( -yg, -Binf/2 )
            p5 = plane.PointAt( -(yg - tinf), -Binf/2 ) 
            p6 = plane.PointAt( -(yg - tinf), -ta/2 )
            p7 = plane.PointAt( (H - yg - tsup), -ta/2)
            p8 = plane.PointAt( (H - yg - tsup), -Bsup/2 )
            p9 = plane.PointAt( (H - yg ), -Bsup/2 )
            p10 = plane.PointAt( (H - yg ), Bsup/2 )
            p11 = plane.PointAt( (H - yg - tsup), Bsup/2 )
            p12 = plane.PointAt( (H - yg - tsup), ta/2 )
        
            wirframe  = [ p1, p2, p3, p4, p5, p6, p7, p8, p9, p10, p11, p12 ] 
            return wirframe
        
        def defShellQuad( ele, node, nodeDisp, scaleDef ):
            
            eleTag = ele[0]
            eleNodeTag = ele[1]
            color = ele[2][2]
            thick = ele[2][1]
            index1 = eleNodeTag[0]
            index2 = eleNodeTag[1]
            index3 = eleNodeTag[2]
            index4 = eleNodeTag[3]
            
            trasl1 = nodeDisp.get( index1 -1 , "never")[0]
            rotate1 = nodeDisp.get( index1 -1 , "never")[1]
            
            trasl2 = nodeDisp.get( index2 -1 , "never")[0]
            rotate2 = nodeDisp.get( index2 -1 , "never")[1]
            
            trasl3 = nodeDisp.get( index3 -1 , "never")[0]
            rotate3 = nodeDisp.get( index3 -1 , "never")[1]
            
            trasl4 = nodeDisp.get( index4 -1 , "never")[0]
            rotate4 = nodeDisp.get( index4 -1 , "never")[1]
            
            ## CREO IL MODELLO DEFORMATO  ##
            
            pointDef1 = rg.Point3d.Clone( node.get( index1 -1 , "never") )
            pointDef2 = rg.Point3d.Clone( node.get( index2 -1 , "never") )
            pointDef3 = rg.Point3d.Clone( node.get( index3 -1 , "never") )
            pointDef4 = rg.Point3d.Clone( node.get( index4 -1 , "never") )
            vectortrasl1 = rg.Transform.Translation( rg.Vector3d(trasl1.X, trasl1.Y, trasl1.Z)*scaleDef )
            pointDef1.Transform( vectortrasl1 )
            vectortrasl2 = rg.Transform.Translation( rg.Vector3d(trasl2.X, trasl2.Y, trasl2.Z)*scaleDef )
            pointDef2.Transform( vectortrasl2 )
            vectortrasl3 = rg.Transform.Translation( rg.Vector3d(trasl3.X, trasl3.Y, trasl3.Z)*scaleDef )
            pointDef3.Transform( vectortrasl3 )
            vectortrasl4 = rg.Transform.Translation( rg.Vector3d(trasl4.X, trasl4.Y, trasl4.Z)*scaleDef )
            pointDef4.Transform( vectortrasl4 )
            shellDefModel = rg.Mesh()
            shellDefModel.Vertices.Add( pointDef1 ) #0
            shellDefModel.Vertices.Add( pointDef2 ) #1
            shellDefModel.Vertices.Add( pointDef3 ) #2
            shellDefModel.Vertices.Add( pointDef4 ) #3
            
            
            shellDefModel.Faces.AddFace(0, 1, 2, 3)
            colour = rs.CreateColor( color[0], color[1], color[2] )
            shellDefModel.VertexColors.CreateMonotoneMesh( colour )
        
            vt = shellDefModel.Vertices
            shellDefModel.FaceNormals.ComputeFaceNormals()
            fid,MPt = shellDefModel.ClosestPoint(vt[0],0.01)
            normalFace = shellDefModel.FaceNormals[fid]
            vectormoltiplicate = rg.Vector3d.Multiply( -normalFace, thick/2 )
            trasl = rg.Transform.Translation( vectormoltiplicate )
            moveShell = rg.Mesh.DuplicateMesh(shellDefModel)
            moveShell.Transform( trasl )
            extrudeShell = rg.Mesh.Offset( moveShell, thick, True, normalFace)
            return  [shellDefModel,[trasl1, trasl2, trasl3, trasl4], [rotate1, rotate2, rotate3, rotate4], extrudeShell ]
        
        def defShellTriangle( ele, node, nodeDisp, scaleDef ):
            
            eleTag = ele[0]
            eleNodeTag = ele[1]
            color = ele[2][2]
            thick = ele[2][1]
            index1 = eleNodeTag[0]
            index2 = eleNodeTag[1]
            index3 = eleNodeTag[2]
            
            trasl1 = nodeDisp.get( index1 -1 , "never")[0]
            rotate1 = nodeDisp.get( index1 -1 , "never")[1]
            
            trasl2 = nodeDisp.get( index2 -1 , "never")[0]
            rotate2 = nodeDisp.get( index2 -1 , "never")[1]
            
            trasl3 = nodeDisp.get( index3 -1 , "never")[0]
            rotate3 = nodeDisp.get( index3 -1 , "never")[1]
            
            ## CREO IL MODELLO DEFORMATO  ##
            pointDef1 = rg.Point3d.Clone( node.get( index1 -1 , "never") )
            pointDef2 = rg.Point3d.Clone( node.get( index2 -1 , "never") )
            pointDef3 = rg.Point3d.Clone( node.get( index3 -1 , "never") )
            vectortrasl1 = rg.Transform.Translation( rg.Vector3d(trasl1.X, trasl1.Y, trasl1.Z)*scaleDef )
            pointDef1.Transform( vectortrasl1 )
            vectortrasl2 = rg.Transform.Translation( rg.Vector3d(trasl2.X, trasl2.Y, trasl2.Z)*scaleDef )
            pointDef2.Transform( vectortrasl2 )
            vectortrasl3 = rg.Transform.Translation( rg.Vector3d(trasl3.X, trasl3.Y, trasl3.Z)*scaleDef )
            pointDef3.Transform( vectortrasl3 )
            shellDefModel = rg.Mesh()
            shellDefModel.Vertices.Add( pointDef1 ) #0
            shellDefModel.Vertices.Add( pointDef2 ) #1
            shellDefModel.Vertices.Add( pointDef3 ) #2
            
            shellDefModel.Faces.AddFace(0, 1, 2)
            colour = rs.CreateColor( color[0], color[1], color[2] )
            shellDefModel.VertexColors.CreateMonotoneMesh( colour )
        
        
            vt = shellDefModel.Vertices
            shellDefModel.FaceNormals.ComputeFaceNormals()
            fid,MPt = shellDefModel.ClosestPoint(vt[0],0.01)
            normalFace = shellDefModel.FaceNormals[fid]
            vectormoltiplicate = rg.Vector3d.Multiply( -normalFace, thick/2 )
            trasl = rg.Transform.Translation( vectormoltiplicate )
            moveShell = rg.Mesh.DuplicateMesh(shellDefModel)
            moveShell.Transform( trasl )
            extrudeShell = rg.Mesh.Offset( moveShell, thick, True, normalFace)
            return  [shellDefModel,[trasl1, trasl2, trasl3], [rotate1, rotate2, rotate3], extrudeShell ]
        
        def defSolid( ele, node, nodeDisp, scaleDef ):
            
            eleTag = ele[0]
            eleNodeTag = ele[1]
            color = ele[2][1]
            thick = ele[2][1]
            #print( eleNodeTag )
            index1 = eleNodeTag[0]
            index2 = eleNodeTag[1]
            index3 = eleNodeTag[2]
            index4 = eleNodeTag[3]
            index5 = eleNodeTag[4]
            index6 = eleNodeTag[5]
            index7 = eleNodeTag[6]
            index8 = eleNodeTag[7]
            
            trasl1 = nodeDisp.get( index1 -1 , "never")
            trasl2 = nodeDisp.get( index2 -1 , "never")
            trasl3 = nodeDisp.get( index3 -1 , "never")
            trasl4 = nodeDisp.get( index4 -1 , "never")
            trasl5 = nodeDisp.get( index5 -1 , "never")
            trasl6 = nodeDisp.get( index6 -1 , "never")
            trasl7 = nodeDisp.get( index7 -1 , "never")
            trasl8 = nodeDisp.get( index8 -1 , "never")
            #print( trasl1 )
            ## CREO IL MODELLO DEFORMATO  ##
            pointDef1 = rg.Point3d.Clone( node.get( index1 -1 , "never") )
            pointDef2 = rg.Point3d.Clone( node.get( index2 -1 , "never") )
            pointDef3 = rg.Point3d.Clone( node.get( index3 -1 , "never") )
            pointDef4 = rg.Point3d.Clone( node.get( index4 -1 , "never") )
            pointDef5 = rg.Point3d.Clone( node.get( index5 -1 , "never") )
            pointDef6 = rg.Point3d.Clone( node.get( index6 -1 , "never") )
            pointDef7 = rg.Point3d.Clone( node.get( index7 -1 , "never") )
            pointDef8 = rg.Point3d.Clone( node.get( index8 -1 , "never") )
            vectortrasl1 = rg.Transform.Translation( rg.Vector3d(trasl1.X, trasl1.Y, trasl1.Z)*scaleDef )
            pointDef1.Transform( vectortrasl1 )
            vectortrasl2 = rg.Transform.Translation( rg.Vector3d(trasl2.X, trasl2.Y, trasl2.Z)*scaleDef )
            pointDef2.Transform( vectortrasl2 )
            vectortrasl3 = rg.Transform.Translation( rg.Vector3d(trasl3.X, trasl3.Y, trasl3.Z)*scaleDef )
            pointDef3.Transform( vectortrasl3 )
            vectortrasl4 = rg.Transform.Translation( rg.Vector3d(trasl4.X, trasl4.Y, trasl4.Z)*scaleDef )
            pointDef4.Transform( vectortrasl4 )
            vectortrasl5 = rg.Transform.Translation( rg.Vector3d(trasl5.X, trasl5.Y, trasl5.Z)*scaleDef )
            pointDef5.Transform( vectortrasl1 )
            vectortrasl6 = rg.Transform.Translation( rg.Vector3d(trasl6.X, trasl6.Y, trasl6.Z)*scaleDef )
            pointDef6.Transform( vectortrasl2 )
            vectortrasl7 = rg.Transform.Translation( rg.Vector3d(trasl7.X, trasl7.Y, trasl7.Z)*scaleDef )
            pointDef7.Transform( vectortrasl3 )
            vectortrasl8 = rg.Transform.Translation( rg.Vector3d(trasl8.X, trasl8.Y, trasl8.Z)*scaleDef )
            pointDef8.Transform( vectortrasl4 )
            
            shellDefModel = rg.Mesh()
            shellDefModel.Vertices.Add( pointDef1 ) #0
            shellDefModel.Vertices.Add( pointDef2 ) #1
            shellDefModel.Vertices.Add( pointDef3 ) #2
            shellDefModel.Vertices.Add( pointDef4 ) #3
            shellDefModel.Vertices.Add( pointDef5 ) #4
            shellDefModel.Vertices.Add( pointDef6 ) #5
            shellDefModel.Vertices.Add( pointDef7 ) #6
            shellDefModel.Vertices.Add( pointDef8 ) #7
        
            shellDefModel.Faces.AddFace(0, 1, 2, 3)
            shellDefModel.Faces.AddFace(4, 5, 6, 7)
            shellDefModel.Faces.AddFace(0, 1, 5, 4)
            shellDefModel.Faces.AddFace(1, 2, 6, 5)
            shellDefModel.Faces.AddFace(2, 3, 7, 6)
            shellDefModel.Faces.AddFace(3, 0, 4, 7)
            
            colour = rs.CreateColor( color[0], color[1], color[2] )
            shellDefModel.VertexColors.CreateMonotoneMesh( colour )
            return  [shellDefModel,[trasl1, trasl2, trasl3,trasl4, trasl5, trasl6, trasl7, trasl8 ]]
        
        def defTetraSolid( ele, node, nodeDisp, scaleDef ):
            
            eleTag = ele[0]
            eleNodeTag = ele[1]
            color = ele[2][1]
            #print( eleNodeTag )
            index1 = eleNodeTag[0]
            index2 = eleNodeTag[1]
            index3 = eleNodeTag[2]
            index4 = eleNodeTag[3]
            
            trasl1 = nodeDisp.get( index1 -1 , "never")
            trasl2 = nodeDisp.get( index2 -1 , "never")
            trasl3 = nodeDisp.get( index3 -1 , "never")
            trasl4 = nodeDisp.get( index4 -1 , "never")
            
            ## CREO IL MODELLO DEFORMATO  ##
            pointDef1 = rg.Point3d.Clone( node.get( index1 -1 , "never") )
            pointDef2 = rg.Point3d.Clone( node.get( index2 -1 , "never") )
            pointDef3 = rg.Point3d.Clone( node.get( index3 -1 , "never") )
            pointDef4 = rg.Point3d.Clone( node.get( index4 -1 , "never") )
            
            vectortrasl1 = rg.Transform.Translation( rg.Vector3d(trasl1.X, trasl1.Y, trasl1.Z)*scaleDef )
            pointDef1.Transform( vectortrasl1 )
            vectortrasl2 = rg.Transform.Translation( rg.Vector3d(trasl2.X, trasl2.Y, trasl2.Z)*scaleDef )
            pointDef2.Transform( vectortrasl2 )
            vectortrasl3 = rg.Transform.Translation( rg.Vector3d(trasl3.X, trasl3.Y, trasl3.Z)*scaleDef )
            pointDef3.Transform( vectortrasl3 )
            vectortrasl4 = rg.Transform.Translation( rg.Vector3d(trasl4.X, trasl4.Y, trasl4.Z)*scaleDef )
            pointDef4.Transform( vectortrasl4 )
        
            shellDefModel = rg.Mesh()
            shellDefModel.Vertices.Add( pointDef1 ) #0
            shellDefModel.Vertices.Add( pointDef2 ) #1
            shellDefModel.Vertices.Add( pointDef3 ) #2
            shellDefModel.Vertices.Add( pointDef4 ) #3
            
            
            shellDefModel.Faces.AddFace( 0, 1, 2 )
            shellDefModel.Faces.AddFace( 0, 1, 3 )
            shellDefModel.Faces.AddFace( 1, 2, 3 )
            shellDefModel.Faces.AddFace( 0, 2, 3 )
            colour = rs.CreateColor( color[0], color[1], color[2] )
            shellDefModel.VertexColors.CreateMonotoneMesh( colour )
            
            return  [shellDefModel,[trasl1, trasl2, trasl3, trasl4]]
        ## node e nodeDisp son dictionary ##
        def defValueTimoshenkoBeam( ele, node, nodeDisp, scaleDef ):
            #---------------- WORLD PLANE ----------------------#
            WorldPlane = rg.Plane.WorldXY
            #--------- Propriety TimoshenkoBeam  ----------------#
            TagEle = ele[0]
            propSection = ele[2]
            indexStart = ele[1][0]
            indexEnd = ele[1][1]
            color = propSection[12]
            E = propSection[1]
            G = propSection[2]
            A = propSection[3]
            Avz = propSection[4]
            Avy = propSection[5]
            Jxx = propSection[6]
            Iy = propSection[7]
            Iz = propSection[8]
            #---- traslation and rotation index start & end ------- #
            traslStart = nodeDisp.get( indexStart -1 , "never")[0]
            rotateStart = nodeDisp.get( indexStart -1 , "never")[1]
            traslEnd = nodeDisp.get( indexEnd -1 , "never")[0]
            rotateEnd = nodeDisp.get( indexEnd -1 , "never")[1]
            ##-------------------------------------------- ------------##
            pointStart = node.get( indexStart -1 , "never")
            pointEnd = node.get( indexEnd -1 , "never")
            line = rg.LineCurve( pointStart, pointEnd )
            #-------------------------versor ---------------------------#
            axis1 =  rg.Vector3d( propSection[9][0][0], propSection[9][0][1], propSection[9][0][2]  )
            axis2 =  rg.Vector3d( propSection[9][1][0], propSection[9][1][1], propSection[9][1][2]  )
            axis3 =  rg.Vector3d( propSection[9][2][0], propSection[9][2][1], propSection[9][2][2]  )
            versor = [ axis1, axis2, axis3 ] 
            #---------- WORLD PLANE on point start of line ---------------#
            traslPlane = rg.Transform.Translation( pointStart.X, pointStart.Y, pointStart.Z )
            WorldPlane.Transform( traslPlane )
            #-------------------------------------------------------------#
            planeStart = rg.Plane( pointStart, axis1, axis2 )
            #planeStart = rg.Plane(pointStart, axis3 )
            localPlane = planeStart
            xform = rg.Transform.ChangeBasis( WorldPlane, localPlane )
            localTraslStart = rg.Point3d( traslStart )
            vectorTrasform = rg.Transform.TransformList( xform, [ traslStart, rotateStart, traslEnd, rotateEnd ] )
            #print( vectorTrasform[0] )
            localTraslStart = vectorTrasform[0]
            uI1 = localTraslStart.X # spostamento in direzione dell'asse rosso 
            uI2 = localTraslStart.Y # spostamento in direzione dell'asse verde
            uI3 = localTraslStart.Z # spostamento linea d'asse
            localRotStart = vectorTrasform[1]
            rI1 = localRotStart.X # 
            rI2 = localRotStart.Y # 
            rI3 = localRotStart.Z # 
            localTraslEnd = vectorTrasform[2]
            uJ1 = localTraslEnd.X # spostamento in direzione dell'asse rosso 
            uJ2 = localTraslEnd.Y # spostamento in direzione dell'asse verde
            uJ3 = localTraslEnd.Z # spostamento linea d'asse
            localRotEnd = vectorTrasform[3]
            rJ1 = localRotEnd[0] #  
            rJ2 = localRotEnd[1]  # 
            rJ3 = localRotEnd[2]  # 
            ##------------------ displacement value -------------------------##
            Length = rg.Curve.GetLength( line )
            #divideDistance = 0.5
            segmentCount = Length/0.5
            #print( segmentCount )
            DivCurve = line.DivideByCount( segmentCount, True )
            #DivCurve = line.DivideEquidistant(divideDistance)
            #print( DivCurve )
            if DivCurve == None:
                DivCurve = [ 0, Length]
                
            #s = dg.linspace(0,Length, len(PointsDivLength))
            AlphaY = alphat( E, G, Iy, Avz )
            AlphaZ = alphat( E, G, Iz, Avy )
            
            globalTransVector = []
            globalRotVector = []
            defPoint = []
            defSection = []
            #----------------------- local to global-------------------------#
            xform2 = xform.TryGetInverse()
            #----------------------------------------------------------------#
            for index, x in enumerate(DivCurve):
                beamPoint = line.PointAt(DivCurve[index]) 
                ## SPOSTAMENTO IN DIREZIONE DELL' ASSE 3 ##
                u3 = spostu(x, Length, uI3, uJ3)
                u3Vector = u3*axis3
                ## SPOSTAMENTO IN DIREZIONE DELL' ASSE 1 ##
                v1 =  spostv(x, Length, uI1, uJ1, rI2, rJ2, AlphaY)
                v1Vector = v1*axis1 
                ## SPOSTAMENTO IN DIREZIONE DELL' ASSE 2 ##
                v2 =  spostw(x, Length, uI2, uJ2, rI1, rJ1, AlphaZ)
                v2Vector = v2*axis2 
                
                ## RISULTANTE SPOSTAMENTI ##
                transResult = v1Vector + v2Vector + u3Vector
                
        
                r1x =  psiy(x, Length, uI2, uJ2, rI1, rJ1, AlphaZ)
                r2x =  thetaz(x, Length, uI1, uJ1, rI2, rJ2, AlphaY)
                r3x = phix(x, Length, rI3, rJ3)
                
                rotResult = r1x*axis1 + r2x*axis2 + r3x*axis3
                
                trasl = rg.Transform.Translation( transResult*scaleDef )
                beamPoint.Transform( trasl )
                defPoint.append( beamPoint )
                sectionPlane = rg.Plane( beamPoint, axis1, axis2 )
                sectionPlane.Rotate( scaleDef*r1x, axis1, beamPoint )
                sectionPlane.Rotate( scaleDef*r2x, axis2, beamPoint )
                sectionPlane.Rotate( scaleDef*r3x, axis3, beamPoint )
                if dimSection[0] == 'rectangular' :
                    width, height = dimSection[1], dimSection[2]
                    section = AddRectangleFromCenter( sectionPlane, width, height )
                    defSection.append( section )
                elif dimSection[0] == 'circular' :
                    radius1  = dimSection[1]/2
                    radius2  = dimSection[1]/2 - dimSection[2]
                    section1 = AddCircleFromCenter( sectionPlane, radius1 )
                    if (radius1 - radius2 ) == 0 :
                        defSection.append( section1 )
                    else :
                        section2 = AddCircleFromCenter( sectionPlane, radius2 )
                        defSection.append( [ section1, section2 ] )
                elif dimSection[0] == 'doubleT' :
                    Bsup = dimSection[1]
                    tsup = dimSection[2]
                    Binf = dimSection[3]
                    tinf = dimSection[4]
                    H =  dimSection[5]
                    ta =  dimSection[6]
                    yg =  dimSection[7]
                    section = AddIFromCenter( sectionPlane, Bsup, tsup, Binf, tinf, H, ta, yg )
                    defSection.append( section )
                elif dimSection[0] == 'rectangularHollow' :
                    width, height, thickness = dimSection[1], dimSection[2], dimSection[3]
                    section1 = AddRectangleFromCenter( sectionPlane, width, height )
                    section2 = AddRectangleFromCenter( sectionPlane, width - (2*thickness), height - (2*thickness) )
                    defSection.append( [ section1, section2 ] )
                elif dimSection[0] == 'Generic' :
                    radius  = dimSection[1]
                    section = AddCircleFromCenter( sectionPlane, radius )
                    defSection.append( section )
            
                globalTrasl = rg.Point3d( transResult ) 
                globalTrasl.Transform(xform2[1]) 
                globalTrasl.Transform(xform)
                globalTransVector.append( globalTrasl )
        
           
            defpolyline = rg.PolylineCurve( defPoint )
        
            if dimSection[0] == 'circular' :
                radius1  = dimSection[1]/2
                radius2  = dimSection[1]/2 - dimSection[2]
                if (radius1 - radius2 ) == 0:
                    meshdef = meshLoft3( defSection,  color )
                else :
                    defSection1 = [row[0] for row in defSection ]
                    defSection2 = [row[1] for row in defSection ]
                    meshdef = meshLoft3( defSection1,  color )
                    meshdef.Append( meshLoft3( defSection2,  color ) )
            elif dimSection[0] == 'rectangularHollow' :
                    defSection1 = [row[0] for row in defSection ]
                    defSection2 = [row[1] for row in defSection ]
                    meshdef = meshLoft3( defSection1,  color )
                    meshdef.Append( meshLoft3( defSection2,  color ) )
            else  :
                meshdef = meshLoft3( defSection,  color )
            return  [  defpolyline, meshdef ,  globalTransVector, globalRotVector ] 
        
        ## node e nodeDisp son dictionary ##
        def defTruss( ele, node, nodeDisp, scale ):
            WorldPlane = rg.Plane.WorldXY
            TagEle = ele[0]
            propSection = ele[2]
            color = propSection[12]
            indexStart = ele[1][0]
            indexEnd = ele[1][1]
            E = propSection[1]
            A = propSection[3]
            
            traslStart = nodeDisp.get( indexStart -1 , "never")
            traslEnd = nodeDisp.get( indexEnd -1 , "never")
            if len( traslStart ) == 2:
                traslStart = nodeDisp.get( indexStart -1 , "never")[0]
                traslEnd = nodeDisp.get( indexEnd -1 , "never")[0]
            pointStart = node.get( indexStart -1 , "never")
            pointEnd = node.get( indexEnd -1 , "never")
            #print( traslStart[1] )
            line = rg.LineCurve( pointStart,  pointEnd )
            axis1 =  rg.Vector3d( propSection[9][0][0], propSection[9][0][1], propSection[9][0][2]  )
            axis2 =  rg.Vector3d( propSection[9][1][0], propSection[9][1][1], propSection[9][1][2]  )
            axis3 =  rg.Vector3d( propSection[9][2][0], propSection[9][2][1], propSection[9][2][2]  )
            versor = [ axis1, axis2, axis3 ] 
            #---------- WORLD PLANE on point start of line ---------------#
            traslPlane = rg.Transform.Translation( pointStart.X, pointStart.Y, pointStart.Z )
            WorldPlane.Transform( traslPlane )
            #-------------------------------------------------------------#
            planeStart = rg.Plane(pointStart, axis1, axis2 )
            #planeStart = rg.Plane(pointStart, axis3 )
            localPlane = planeStart
            xform = rg.Transform.ChangeBasis( WorldPlane, localPlane )
            localTraslStart = rg.Point3d( traslStart )
            vectorTrasform = rg.Transform.TransformList( xform, [ traslStart , traslEnd ] )
            #print( vectorTrasform[0] )
            localTraslStart = vectorTrasform[0]
            uI1 = localTraslStart.X # spostamento in direzione dell'asse rosso 
            uI2 = localTraslStart.Y # spostamento in direzione dell'asse verde
            uI3 = localTraslStart.Z # spostamento linea d'asse
            localTraslEnd = vectorTrasform[1]
            uJ1 = localTraslEnd.X # spostamento in direzione dell'asse rosso 
            uJ2 = localTraslEnd.Y # spostamento in direzione dell'asse verde
            uJ3 = localTraslEnd.Z # spostamento linea d'asse
            ##-------------- displacement value -------------------------##
            Length = rg.Curve.GetLength( line )
            #divideDistance = 0.5
            segmentCount = Length/0.5
            #print( segmentCount )
            DivCurve = line.DivideByCount( segmentCount, True )
            #DivCurve = line.DivideEquidistant(divideDistance)
            #print( DivCurve )
            if DivCurve == None:
                DivCurve = [ 0, Length]
            defPoint = []
            defSection = []
            globalTransVector = []
            #----------------------- local to global-------------------------#
            xform2 = xform.TryGetInverse()
            #----------------------------------------------------------------#
            for index, x in enumerate(DivCurve):
                beamPoint = line.PointAt(DivCurve[index]) 
                ## SPOSTAMENTO IN DIREZIONE DELL' ASSE 3 ##
                u3 = spostu(x, Length, uI3, uJ3)
                u3Vector = u3*axis3
                ## SPOSTAMENTO IN DIREZIONE DELL' ASSE 1 ##
                v1 =  x*( uJ1 - uI1 )/Length + uI1
                v1Vector = v1*axis1 
                ## SPOSTAMENTO IN DIREZIONE DELL' ASSE 2 ##
                v2 =  x*( uJ2 - uI2 )/Length + uI2
                v2Vector = v2*axis2 
                ## RISULTANTE SPOSTAMENTI ##
                transResult = v1Vector + v2Vector + u3Vector
                trasl = rg.Transform.Translation( transResult*scale )
                beamPoint.Transform( trasl )
                defPoint.append( beamPoint )
                
                sectionPlane = rg.Plane( beamPoint, axis1, axis2 )
                if dimSection[0] == 'rectangular' :
                    width, height = dimSection[1], dimSection[2]
                    section = AddRectangleFromCenter( sectionPlane, width, height )
                    defSection.append( section )
                elif dimSection[0] == 'circular' :
                    radius1  = dimSection[1]/2
                    radius2  = dimSection[1]/2 - dimSection[2]
                    section1 = AddCircleFromCenter( sectionPlane, radius1 )
                    if (radius1 - radius2 ) == 0 :
                        defSection.append( section1 )
                    else :
                        section2 = AddCircleFromCenter( sectionPlane, radius2 )
                        defSection.append( [ section1, section2 ] )
                elif dimSection[0] == 'doubleT' :
                    Bsup = dimSection[1]
                    tsup = dimSection[2]
                    Binf = dimSection[3]
                    tinf = dimSection[4]
                    H =  dimSection[5]
                    ta =  dimSection[6]
                    yg =  dimSection[7]
                    section = AddIFromCenter( sectionPlane, Bsup, tsup, Binf, tinf, H, ta, yg )
                    defSection.append( section )
                elif dimSection[0] == 'rectangularHollow' :
                    width, height, thickness = dimSection[1], dimSection[2], dimSection[3]
                    section1 = AddRectangleFromCenter( sectionPlane, width, height )
                    section2 = AddRectangleFromCenter( sectionPlane, width - (2*thickness), height - (2*thickness) )
                    defSection.append( [ section1, section2 ] )
                elif dimSection[0] == 'Generic' :
                    radius  = dimSection[1]
                    section = AddCircleFromCenter( sectionPlane, radius )
                    defSection.append( section )
            
                globalTrasl = rg.Point3d( transResult ) 
                globalTrasl.Transform(xform2[1]) 
                globalTrasl.Transform(xform)
                globalTransVector.append( globalTrasl )
        
           
            defpolyline = rg.PolylineCurve( defPoint )
        
            if dimSection[0] == 'circular' :
                radius1  = dimSection[1]/2
                radius2  = dimSection[1]/2 - dimSection[2]
                if (radius1 - radius2 ) == 0:
                    meshdef = meshLoft3( defSection,  color )
                else :
                    defSection1 = [row[0] for row in defSection ]
                    defSection2 = [row[1] for row in defSection ]
                    meshdef = meshLoft3( defSection1,  color )
                    meshdef.Append( meshLoft3( defSection2,  color ) )
            elif dimSection[0] == 'rectangularHollow' :
                    defSection1 = [row[0] for row in defSection ]
                    defSection2 = [row[1] for row in defSection ]
                    meshdef = meshLoft3( defSection1,  color )
                    meshdef.Append( meshLoft3( defSection2,  color ) )
            else  :
                meshdef = meshLoft3( defSection,  color )
        
            return  [ defpolyline, meshdef, globalTransVector]
        
        ## Mesh from close section eith gradient color ##
        def meshLoft3( point, color ):
            #print( point )
            meshEle = rg.Mesh()
            pointSection1 = point
            for i in range(0,len(pointSection1)):
                for j in range(0, len(pointSection1[0])):
                    vertix = pointSection1[i][j]
                    #print( type(vertix) )
                    meshEle.Vertices.Add( vertix ) 
                    #meshEle.VertexColors.Add( color[0],color[1],color[2] );
            k = len(pointSection1[0])
            for i in range(0,len(pointSection1)-1):
                for j in range(0, len(pointSection1[0])):
                    if j < k-1:
                        index1 = i*k + j
                        index2 = (i+1)*k + j
                        index3 = index2 + 1
                        index4 = index1 + 1
                    elif j == k-1:
                        index1 = i*k + j
                        index2 = (i+1)*k + j
                        index3 = (i+1)*k
                        index4 = i*k
                    meshEle.Faces.AddFace(index1, index2, index3, index4)
                    #rs.ObjectColor(scyl,(255,0,0))
            colour = rs.CreateColor( color[0], color[1], color[2] )
            meshEle.VertexColors.CreateMonotoneMesh( colour )
            meshElement = meshEle
            #meshdElement.IsClosed(True)
            
            return meshElement
        
        def gradient(value, valueMin, valueMax, colorList ):
        
            if colorList == [] :
                listcolor = [ rs.CreateColor( 201, 0, 0 ),
                            rs.CreateColor( 240, 69, 7),
                            rs.CreateColor( 251, 255, 0 ),
                            rs.CreateColor( 77, 255, 0 ),
                            rs.CreateColor( 0, 255, 221 ),
                            rs.CreateColor( 0, 81, 255 )]
            else :
                listcolor = colorList
        
            n = len( listcolor )
            domain = linspace( valueMin, valueMax, n)
            #print( domain )
            
            for i in range(1,n+1):
                if  domain[i-1] <= value <= domain[i] :
                    return listcolor[ i-1 ]
                elif  valueMax <= value <= valueMax + 0.0000000000001 :
                    return listcolor[ -1 ]
                elif  valueMin - 0.0000000000001 <= value <= valueMin  :
                    return listcolor[ 0 ]
        
        ## Mesh from close section eith gradient color ##
        def meshLoft4( point, value, valueMax, valueMin ):
            meshEle = rg.Mesh()
            for i in range(0,len(point)):
                color = gradientJet( value[i], valueMax, valueMin )
                for j in range(0, len(point[0])):
                    vertix = point[i][j]
                    meshEle.Vertices.Add( vertix ) 
                    meshEle.VertexColors.Add( color[0],color[1],color[2] );
            k = len(point[0])
            for i in range(0,len(point)-1):
                for j in range(0, len(point[0])):
                    if j < k-1:
                        index1 = i*k + j
                        index2 = (i+1)*k + j
                        index3 = index2 + 1
                        index4 = index1 + 1
                    elif j == k-1:
                        index1 = i*k + j
                        index2 = (i+1)*k + j
                        index3 = (i+1)*k
                        index4 = i*k
                    meshEle.Faces.AddFace(index1, index2, index3, index4)
            return meshEle
        
        
        
        def DeformedModelView(AlpacaStaticOutput, scale, modelExtrud, direction, colorList):
            
            
            global dimSection
            
            diplacementWrapper = AlpacaStaticOutput[0]
            EleOut = AlpacaStaticOutput[2]
            nodeValue = []
            displacementValue = []
            #ShellOut = openSeesOutputWrapper[4]
            
            pointWrapper = []
            dispWrapper = []
            #print( diplacementWrapper )
            for index,item in enumerate(diplacementWrapper):
                nodeValue.append( item[0] )
                displacementValue.append( item[1] )
                pointWrapper.append( [index, rg.Point3d(item[0][0],item[0][1],item[0][2]) ] )
                if len(item[1]) == 3:
                    dispWrapper.append( [index, rg.Point3d( item[1][0], item[1][1], item[1][2] ) ] )
                elif len(item[1]) == 6:
                    dispWrapper.append( [index, [rg.Point3d(item[1][0],item[1][1],item[1][2] ), rg.Point3d(item[1][3],item[1][4],item[1][5]) ] ] )
            
            ## Dict. for point ##
            pointWrapperDict = dict( pointWrapper )
            pointDispWrapperDict = dict( dispWrapper )
            ####
            
            ## FOR scala automatica ##
            ## nodeValue è la lista delle cordinate
            rowX = [row[0] for row in nodeValue ]
            rowY = [row[1] for row in nodeValue ]
            rowZ = [row[2] for row in nodeValue ]
            
            scaleMax = max( max(rowX), max(rowY), max(rowZ) )
            scaleMin = min( min(rowX), min(rowY), min(rowZ) )
            coordMax = max( math.fabs(scaleMin),math.fabs(scaleMax)) - math.fabs(scaleMin)
            
            ## displacementValue è la lista degli spostamenti
            
            rowDefX = [row[0] for row in displacementValue ]
            rowDefY = [row[1] for row in displacementValue ]
            rowDefZ = [row[2] for row in displacementValue ]
            
            defMax = max( max(rowDefX), max(rowDefY), max(rowDefZ) )
            defMin = min( min(rowDefX), min(rowDefY), min(rowDefZ) )
            DefMax = max( math.fabs(defMax),math.fabs(defMin))
            
            if scale == None:
                scaleDef = scaleAutomatic( coordMax , DefMax )
            
            else :
                scaleDef = scale
            
            ExtrudedView = []
            modelDisp = []
            
            modelCurve = []
            traslBeamValue = []
            rotBeamValue = []
            
            ShellDefModel = []
            traslShellValue = []
            rotShellValue = []
            
            SolidDefModel = []
            traslSolidValue = []
            
            
            for ele in EleOut :
                eleType = ele[2][0]
                nNode = len( ele[1] )
                
                if eleType == 'ElasticTimoshenkoBeam' :
                    
                    dimSection = ele[2][10]
                    color = ele[2][12]
                    valueTBeam = defValueTimoshenkoBeam( ele, pointWrapperDict, pointDispWrapperDict, scaleDef )
                    defpolyline = valueTBeam[0]
                    meshdef = valueTBeam[1]
                    globalTrans = valueTBeam[2]
                    globalRot = valueTBeam[3]
                    traslBeamValue.append( globalTrans ) 
                    rotBeamValue.append( globalRot )
                    modelCurve.append( defpolyline )
                    modelDisp.append( defpolyline )
                    # estrusione della beam #
                    ExtrudedView.append( meshdef )
                    #doc.Objects.AddMesh( meshdef )
                elif eleType == 'Truss' :
                    dimSection = ele[2][10]
                    color = ele[2][12]
                    #print( color )
                    valueTruss = defTruss( ele, pointWrapperDict, pointDispWrapperDict, scaleDef )
                    defpolyline = valueTruss[0]
                    meshdef = valueTruss[1]
                    globalTrans = valueTruss[2]
                    traslBeamValue.append( globalTrans ) 
                    modelCurve.append( defpolyline )
                    ExtrudedView.append( meshdef )
                    modelDisp.append( defpolyline )
                    #doc.Objects.AddMesh( meshdef )
            
                elif nNode == 4 and eleType != 'FourNodeTetrahedron':
                    shellDefModel = defShellQuad( ele, pointWrapperDict, pointDispWrapperDict, scaleDef )
                    ShellDefModel.append( shellDefModel[0] )
                    traslShellValue.append( shellDefModel[1] )
                    rotShellValue.append( shellDefModel[2] )
                    extrudeShell = shellDefModel[3]
                    ExtrudedView.append( extrudeShell )
                    #doc.Objects.AddMesh( extrudeShell)
                    
                elif nNode == 3:
                    #print( nNode )
                    shellDefModel = defShellTriangle( ele, pointWrapperDict, pointDispWrapperDict, scaleDef )
                    ShellDefModel.append( shellDefModel[0] )
                    traslShellValue.append( shellDefModel[1] )
                    rotShellValue.append( shellDefModel[2] )
                    extrudeShell = shellDefModel[3]
                    ExtrudedView.append( extrudeShell )
                    #doc.Objects.AddMesh( extrudeShell)
                    
                elif nNode == 8:
                    solidDefModel = defSolid( ele, pointWrapperDict, pointDispWrapperDict, scaleDef)
                    SolidDefModel.append( solidDefModel[0] )
                    #doc.Objects.AddMesh( solidDefModel[0] )
                    traslSolidValue.append( solidDefModel[1] )
                    ExtrudedView.append( solidDefModel[0] )
                    
                elif  eleType == 'FourNodeTetrahedron' :
                    #print(ele)
                    solidDefModel = defTetraSolid( ele, pointWrapperDict, pointDispWrapperDict, scaleDef )
                    SolidDefModel.append( solidDefModel[0] )
                    traslSolidValue.append( solidDefModel[1] )
                    ExtrudedView.append( solidDefModel[0] )
                    
                # MAX an MIN VALOR
            valorVector = []
            # beam valor #
            for valuetrasl in traslBeamValue:
                for valor in valuetrasl:
                    vectorTrasl = rg.Vector3d( valor )
                    if direction == 0:
                        valorVector.append( vectorTrasl.X ) 
                    elif direction == 1:
                        valorVector.append( vectorTrasl.Y )
                    elif direction == 2:
                        valorVector.append( vectorTrasl.Z ) 
                    elif direction == 3:
                        valorVector.append( vectorTrasl.Length )     
            # POINT #
            if len(dispWrapper[0][1]) == 3 :
                PointDisp = [row[1] for row in dispWrapper ] 
            else:
                PointDisp = [row[1][0] for row in dispWrapper ]
            
            for nodeDisp in PointDisp :
                vectorNodeDisp = rg.Vector3d( nodeDisp )
                if direction == 0:
                    valorVector.append( vectorNodeDisp.X ) 
                elif direction == 1:
                    valorVector.append( vectorNodeDisp.Y )
                elif direction == 2:
                    valorVector.append( vectorNodeDisp.Z ) 
                elif direction == 3:
                    valorVector.append( vectorNodeDisp.Length )
            # MAX end MIN on structures point #
            lowerLimit = min( valorVector )
            upperLimit = max( valorVector )
            domainValues = [ lowerLimit, upperLimit ]
            #print( lowerLimit, upperLimit )
            #####################################################################################
            colorBeam = []
            numberDivide = []
            for value in traslBeamValue :
                colorValor = []
                for valor in value:
                    vectorTrasl = rg.Vector3d( valor )
            
                    if direction == 0:
                        valorVector = vectorTrasl.X  
                    elif direction == 1:
                        valorVector = vectorTrasl.Y 
                    elif direction == 2:
                        valorVector = vectorTrasl.Z  
                    elif direction == 3:
                        valorVector = vectorTrasl.Length
            
                    color = gradient( valorVector, lowerLimit, upperLimit, colorList )
                    colorValor.append( color )
                colorBeam.append( colorValor )
                numberDivide.append( len(colorValor) )
            segment = []
            for curve, segmentCount in zip( modelCurve, numberDivide ):
                parameter = curve.DivideByCount( segmentCount - 1, True )
                segmentCurve = []
                for i in range(1, len(parameter)) :
                        p1 =  rg.Curve.PointAt( curve, parameter[i-1] ) 
                        p2 = rg.Curve.PointAt( curve, parameter[i] )
                        segmentCurve.append( rg.Line( p1, p2 ) )
                segment.append( segmentCurve )
            
            
            for shellEle, value in zip(ShellDefModel,traslShellValue) :
                shellColor = shellEle.DuplicateMesh()
                shellColor.VertexColors.Clear()
                for j in range( 0,shellEle.Vertices.Count ):
                    vectorTrasl = rg.Vector3d( value[j] )
                    if direction == 0:
                        valorVector = vectorTrasl.X  
                    elif direction == 1:
                        valorVector = vectorTrasl.Y 
                    elif direction == 2:
                        valorVector = vectorTrasl.Z  
                    elif direction == 3:
                        valorVector = vectorTrasl.Length
            
                    color = gradient( valorVector, lowerLimit, upperLimit, colorList )
                    shellColor.VertexColors.Add( color )
                modelDisp.append( shellColor)
             #dup.VertexColors.CreateMonotoneMesh(Color.Red)
            #doc.Objects.AddMesh(dup)
            for solidEle, value in zip(SolidDefModel,traslSolidValue) :
                solidColor = solidEle.DuplicateMesh()
                solidColor.VertexColors.Clear()
                for j in range(0,solidEle.Vertices.Count):
                    vectorTrasl = rg.Vector3d( value[j] )
                    if direction == 0:
                        valorVector = vectorTrasl.X  
                    elif direction == 1:
                        valorVector = vectorTrasl.Y 
                    elif direction == 2:
                        valorVector = vectorTrasl.Z  
                    elif direction == 3:
                        valorVector = vectorTrasl.Length
            
                    color = gradient( valorVector, lowerLimit, upperLimit, colorList )
                    solidColor.VertexColors.Add( color )
                modelDisp.append( solidColor )
                
            if modelExtrud == False or modelExtrud == None:
                self.line = segment
                self.colorLine = colorBeam
                return modelDisp, domainValues
            else:
                self.line = []
                self.colorLine = []
                return ExtrudedView, domainValues


        
        checkData = True
        
        if not AlpacaStaticOutput:
            checkData = False
            msg = "input 'AlpacaStaticOutput' failed to collect data"  
            ghenv.Component.AddRuntimeMessage(gh.Kernel.GH_RuntimeMessageLevel.Warning, msg)
        
        if checkData != False:
            modelDisp, domainValues = DeformedModelView(AlpacaStaticOutput, scale, modelExtrud, direction, colorList)
            return (modelDisp, domainValues)


    def DrawViewportWires(self,arg):
        
        for crvs, colors in zip(self.line, self.colorLine):
            for crv, color in zip(crvs, colors):
                arg.Display.DrawLine(crv, color, 4)
# ---------- end python_28 ----------
panel_21 = Panel(merge_6)
# displacement Component
cluster_3 = Cluster(gate=0)

python_29 = GhPythonScript()  # -> out, a
# ---------- python_29: Python ----------
__author__ = "FORMAT"
__version__ = "2020.08.25"

import rhinoscriptsyntax as rs
import Rhino.Geometry as rg

rg.Line
# ---------- end python_29 ----------

# ---- group: jet
merge_9 = Merge(
    Data1=ColourSwatch(SwatchColor=RGB(201, 0, 0)),
    Data2=ColourSwatch(SwatchColor=RGB(240, 69, 7)),
    Data3=ColourSwatch(SwatchColor=RGB(251, 255, 0)),
    Data4=ColourSwatch(SwatchColor=RGB(77, 255, 0)),
    Data5=ColourSwatch(SwatchColor=RGB(0, 255, 221)),
    Data6=ColourSwatch(SwatchColor=RGB(0, 81, 255)))  # -> reverse(Result)

# ----
# Modal Animate
number_slider_7 = Slider(1, range=0..10)
path_5 = FilePath("C:\GitHub\Alpaca4d\PythonScript\Post-Processing\animateModal\animateModal.py")
file_5 = ReadFile(File=path_5, PerLineParse=False)

# ---- group: hsv
merge_10 = Merge(
    Data1=ColourSwatch(SwatchColor=RGB(240, 69, 7)),
    Data2=ColourSwatch(SwatchColor=RGB(251, 255, 0)),
    Data3=ColourSwatch(SwatchColor=RGB(77, 255, 0)),
    Data4=ColourSwatch(SwatchColor=RGB(0, 255, 221)),
    Data5=ColourSwatch(SwatchColor=RGB(67, 136, 247)),
    Data6=ColourSwatch(SwatchColor=RGB(0, 30, 255)),
    Data7=ColourSwatch(SwatchColor=RGB(135, 0, 176)),
    Data8=ColourSwatch(SwatchColor=RGB(247, 0, 103)))

# ----
list_8 = ValueList({"tx": 0, "ty": 1, "tz": 2, "txyz": 3}, selected="txyz")
# ---- group: MODAL ANALYSIS
ghpython_script_2 = GhPythonScript(
    AlpacaModalOutput=analyze_2.AlpacaModalOutput,
    numberMode=number_slider_7,
    speed=Slider(1, range=1..50),
    Animate=Toggle(False),
    Reset=Button(),
    scale=Slider(10, range=0..10),
    direction=list_8,
    modelExstrud=Toggle(False),
    colorList=merge_9)  # -> modelDisp, domainValues; inputs AlpacaModalOutput: list, numberMode: Int32, Animate: Boolean, Reset: Boolean, colorList: list of Color
# ---------- ghpython_script_2: Python ----------
"""Visualize the Modal Shapes
    Inputs:
        AlpacaModalOutput:
        numberMode:
        speed:
        Animate:
        Reset:
        scale:
        ExtrudedModel:
    Output:
        ModelDisp:
        ModelCurve:
        ModelShell:
        ModelSolid:
       """

from ghpythonlib.componentbase import executingcomponent as component
import Grasshopper, GhPython
import System
import Rhino
import rhinoscriptsyntax as rs

class MyComponent(component):
    
    def RunScript(self, AlpacaModalOutput, numberMode, speed, Animate, Reset, scale, direction, modelExstrud, colorList):
        import Rhino as rc
        import Rhino.Geometry as rg
        import math as mt
        import ghpythonlib.treehelpers as th # per data tree
        import Grasshopper as gh
        import sys
        import rhinoscriptsyntax as rs
        import Rhino.Display as rd
        from scriptcontext import sticky as st
        import System.Drawing.Color
        import scriptcontext as sc
        #----------------------------------------------------------------------#
                
        def alphat( E, G, I, At ):
            return (E*I)/(G*At)
    
        ## Spostamenti e rotazioni ##
        def spostu( x, L, uI, uJ ):
            return -(-L*uI + uI*x - uJ*x)/L
            
        def spostv( x, L, vI, vJ, thetaI, thetaJ, alphay ):
            return (L**3*thetaI*x + L**3*vI - 2*L**2*thetaI*x**2 - L**2*thetaJ*x**2 + 6*L*alphay*thetaI*x - 6*L*alphay*thetaJ*x + 12*L*alphay*vI + L*thetaI*x**3 + L*thetaJ*x**3 - 3*L*vI*x**2 + 3*L*vJ*x**2 - 6*alphay*thetaI*x**2 + 6*alphay*thetaJ*x**2 - 12*alphay*vI*x + 12*alphay*vJ*x + 2*vI*x**3 - 2*vJ*x**3)/(L*(L**2 + 12*alphay))
            
        def spostw( x, L, wI, wJ, psiI, psiJ, alphaz ):
            return -(L**3*psiI*x - L**3*wI - 2*L**2*psiI*x**2 - L**2*psiJ*x**2 - 6*L*alphaz*psiI*x + 6*L*alphaz*psiJ*x + 12*L*alphaz*wI + L*psiI*x**3 + L*psiJ*x**3 + 3*L*wI*x**2 - 3*L*wJ*x**2 + 6*alphaz*psiI*x**2 - 6*alphaz*psiJ*x**2 - 12*alphaz*wI*x + 12*alphaz*wJ*x - 2*wI*x**3 + 2*wJ*x**3)/(L*(L**2 - 12*alphaz))
            
        def thetaz(x, L, vI, vJ, thetaI, thetaJ, alphay): 
            return (L**3*thetaI - 4*L**2*thetaI*x - 2*L**2*thetaJ*x + 12*L*alphay*thetaI + 3*L*thetaI*x**2 + 3*L*thetaJ*x**2 - 6*L*vI*x + 6*L*vJ*x - 12*alphay*thetaI*x + 12*alphay*thetaJ*x + 6*vI*x**2 - 6*vJ*x**2)/(L*(L**2 + 12*alphay))
            
        def phix(x, L, phiI, phiJ):
            return -(-L*phiI + phiI*x - phiJ*x)/L
    
        def psiy(x, L, wI, wJ, psiI, psiJ, alphaz): 
            return (L**3*psiI - 4*L**2*psiI*x - 2*L**2*psiJ*x - 12*L*alphaz*psiI + 3*L*psiI*x**2 + 3*L*psiJ*x**2 + 6*L*wI*x - 6*L*wJ*x + 12*alphaz*psiI*x - 12*alphaz*psiJ*x - 6*wI*x**2 + 6*wJ*x**2)/(L*(L**2 - 12*alphaz))
            
        def gammay( L, vI, vJ, thetaI, thetaJ, alphay): 
    
            return (L*thetaI + L*thetaJ + 2*vI - 2*vJ)/(L*(L**2 + 12*alphay))
            
        def gammaz( L, wI, wJ, psiI, psiJ, alphaz):
    
            return -(L*psiI + L*psiJ - 2*wI + 2*wJ)/(L*(L**2 - 12*alphaz))
    
        ##------------------------------------------------------------------------- --##
    
        def scaleAutomatic( Num , Den ):
            if Den < 0.1 :
                return Num
            else :
                return Num*1/Den
    
        def linspace(a, b, n=100):
            if n < 2:
                return b
            diff = (float(b) - a)/(n - 1)
            return [diff * i + a  for i in range(n)]
    
        ## Funzione rettangolo ##
        def AddRectangleFromCenter(plane, width, height):
            a = plane.PointAt(-width * 0.5, -height * 0.5 )
            b = plane.PointAt(-width * 0.5,  height * 0.5 )
            c = plane.PointAt( width * 0.5,  height * 0.5 )
            d = plane.PointAt( width * 0.5,  -height * 0.5 )
            #rectangle = rg.PolylineCurve( [a, b, c, d, a] )
            rectangle  = [a, b, c, d] 
            return rectangle
            
        ## Funzione cerchio ##
        def AddCircleFromCenter( plane, radius):
            t = linspace( 0 , 1.80*mt.pi, 15 )
            a = []
            for ti in t:
                x = radius*mt.cos(ti)
                y = radius*mt.sin(ti)
                a.append( plane.PointAt( x, y ) )
            #circle = rg.PolylineCurve( a )
            circle  = a 
            return circle
    
        def AddIFromCenter(plane, Bsup, tsup, Binf, tinf, H, ta, yg):
    
            p1 = plane.PointAt( -(yg - tinf), ta/2 )
            p2 = plane.PointAt( -(yg - tinf), Binf/2 )
            p3 = plane.PointAt( -yg, Binf/2 )
            p4 = plane.PointAt( -yg, -Binf/2 )
            p5 = plane.PointAt( -(yg - tinf), -Binf/2 ) 
            p6 = plane.PointAt( -(yg - tinf), -ta/2 )
            p7 = plane.PointAt( (H - yg - tsup), -ta/2)
            p8 = plane.PointAt( (H - yg - tsup), -Bsup/2 )
            p9 = plane.PointAt( (H - yg ), -Bsup/2 )
            p10 = plane.PointAt( (H - yg ), Bsup/2 )
            p11 = plane.PointAt( (H - yg - tsup), Bsup/2 )
            p12 = plane.PointAt( (H - yg - tsup), ta/2 )
    
            wirframe  = [ p1, p2, p3, p4, p5, p6, p7, p8, p9, p10, p11, p12 ] 
            return wirframe
            
        def defShellQuad( ele, node, nodeDisp, scaleDef ):
            
            eleTag = ele[0]
            eleNodeTag = ele[1]
            color = ele[2][2]
            thick = ele[2][1]
            index1 = eleNodeTag[0]
            index2 = eleNodeTag[1]
            index3 = eleNodeTag[2]
            index4 = eleNodeTag[3]
            
            trasl1 = nodeDisp.get( index1 -1 , "never")[0]
            rotate1 = nodeDisp.get( index1 -1 , "never")[1]
            
            trasl2 = nodeDisp.get( index2 -1 , "never")[0]
            rotate2 = nodeDisp.get( index2 -1 , "never")[1]
            
            trasl3 = nodeDisp.get( index3 -1 , "never")[0]
            rotate3 = nodeDisp.get( index3 -1 , "never")[1]
            
            trasl4 = nodeDisp.get( index4 -1 , "never")[0]
            rotate4 = nodeDisp.get( index4 -1 , "never")[1]
            
            ## CREO IL MODELLO DEFORMATO  ##
            
            pointDef1 = rg.Vector3d.Clone( node.get( index1 -1 , "never") )
            pointDef2 = rg.Vector3d.Clone( node.get( index2 -1 , "never") )
            pointDef3 = rg.Vector3d.Clone( node.get( index3 -1 , "never") )
            pointDef4 = rg.Vector3d.Clone( node.get( index4 -1 , "never") )
            vectortrasl1 = rg.Transform.Translation( rg.Vector3d(trasl1.X, trasl1.Y, trasl1.Z)*scaleDef )
            pointDef1.Transform( vectortrasl1 )
            vectortrasl2 = rg.Transform.Translation( rg.Vector3d(trasl2.X, trasl2.Y, trasl2.Z)*scaleDef )
            pointDef2.Transform( vectortrasl2 )
            vectortrasl3 = rg.Transform.Translation( rg.Vector3d(trasl3.X, trasl3.Y, trasl3.Z)*scaleDef )
            pointDef3.Transform( vectortrasl3 )
            vectortrasl4 = rg.Transform.Translation( rg.Vector3d(trasl4.X, trasl4.Y, trasl4.Z)*scaleDef )
            pointDef4.Transform( vectortrasl4 )
            shellDefModel = rg.Mesh()
            shellDefModel.Vertices.Add( pointDef1 ) #0
            shellDefModel.Vertices.Add( pointDef2 ) #1
            shellDefModel.Vertices.Add( pointDef3 ) #2
            shellDefModel.Vertices.Add( pointDef4 ) #3
            
            
            shellDefModel.Faces.AddFace(0, 1, 2, 3)
            colour = rs.CreateColor( color[0], color[1], color[2] )
            shellDefModel.VertexColors.CreateMonotoneMesh( colour )
    
            vt = shellDefModel.Vertices
            shellDefModel.FaceNormals.ComputeFaceNormals()
            fid,MPt = shellDefModel.ClosestPoint(vt[0],0.01)
            normalFace = shellDefModel.FaceNormals[fid]
            vectormoltiplicate = rg.Vector3d.Multiply( -normalFace, thick/2 )
            trasl = rg.Transform.Translation( vectormoltiplicate )
            moveShell = rg.Mesh.DuplicateMesh(shellDefModel)
            moveShell.Transform( trasl )
            extrudeShell = rg.Mesh.Offset( moveShell, thick, True, normalFace)
            return  [shellDefModel,[trasl1, trasl2, trasl3, trasl4], [rotate1, rotate2, rotate3, rotate4], extrudeShell ]
    
        def defShellTriangle( ele, node, nodeDisp, scaleDef ):
            
            eleTag = ele[0]
            eleNodeTag = ele[1]
            color = ele[2][2]
            thick = ele[2][1]
            
            index1 = eleNodeTag[0]
            index2 = eleNodeTag[1]
            index3 = eleNodeTag[2]
            
            trasl1 = nodeDisp.get( index1 -1 , "never")[0]
            rotate1 = nodeDisp.get( index1 -1 , "never")[1]
            
            trasl2 = nodeDisp.get( index2 -1 , "never")[0]
            rotate2 = nodeDisp.get( index2 -1 , "never")[1]
            
            trasl3 = nodeDisp.get( index3 -1 , "never")[0]
            rotate3 = nodeDisp.get( index3 -1 , "never")[1]
            
            ## CREO IL MODELLO DEFORMATO  ##
            pointDef1 = rg.Point3d.Clone( node.get( index1 -1 , "never") )
            pointDef2 = rg.Point3d.Clone( node.get( index2 -1 , "never") )
            pointDef3 = rg.Point3d.Clone( node.get( index3 -1 , "never") )
            vectortrasl1 = rg.Transform.Translation( rg.Vector3d(trasl1.X, trasl1.Y, trasl1.Z)*scaleDef )
            pointDef1.Transform( vectortrasl1 )
            vectortrasl2 = rg.Transform.Translation( rg.Vector3d(trasl2.X, trasl2.Y, trasl2.Z)*scaleDef )
            pointDef2.Transform( vectortrasl2 )
            vectortrasl3 = rg.Transform.Translation( rg.Vector3d(trasl3.X, trasl3.Y, trasl3.Z)*scaleDef )
            pointDef3.Transform( vectortrasl3 )
            shellDefModel = rg.Mesh()
            shellDefModel.Vertices.Add( pointDef1 ) #0
            shellDefModel.Vertices.Add( pointDef2 ) #1
            shellDefModel.Vertices.Add( pointDef3 ) #2
            
            shellDefModel.Faces.AddFace(0, 1, 2)
            colour = rs.CreateColor( color[0], color[1], color[2] )
            vt = shellDefModel.Vertices
            shellDefModel.FaceNormals.ComputeFaceNormals()
            fid,MPt = shellDefModel.ClosestPoint(vt[0],0.01)
            normalFace = shellDefModel.FaceNormals[fid]
            vectormoltiplicate = rg.Vector3d.Multiply( -normalFace, thick/2 )
            trasl = rg.Transform.Translation( vectormoltiplicate )
            moveShell = rg.Mesh.DuplicateMesh(shellDefModel)
            moveShell.Transform( trasl )
            extrudeShell = rg.Mesh.Offset( moveShell, thick, True, normalFace)
            return  [shellDefModel,[trasl1, trasl2, trasl3], [rotate1, rotate2, rotate3], extrudeShell ]
    
        def defSolid( ele, node, nodeDisp, scaleDef ):
            
            eleTag = ele[0]
            eleNodeTag = ele[1]
            color = ele[2][1]
            thick = ele[2][1]
            #print( eleNodeTag )
            index1 = eleNodeTag[0]
            index2 = eleNodeTag[1]
            index3 = eleNodeTag[2]
            index4 = eleNodeTag[3]
            index5 = eleNodeTag[4]
            index6 = eleNodeTag[5]
            index7 = eleNodeTag[6]
            index8 = eleNodeTag[7]
            
            trasl1 = nodeDisp.get( index1 -1 , "never")
            trasl2 = nodeDisp.get( index2 -1 , "never")
            trasl3 = nodeDisp.get( index3 -1 , "never")
            trasl4 = nodeDisp.get( index4 -1 , "never")
            trasl5 = nodeDisp.get( index5 -1 , "never")
            trasl6 = nodeDisp.get( index6 -1 , "never")
            trasl7 = nodeDisp.get( index7 -1 , "never")
            trasl8 = nodeDisp.get( index8 -1 , "never")
            
            ## CREO IL MODELLO DEFORMATO  ##
            pointDef1 = rg.Point3d.Clone( node.get( index1 -1 , "never") )
            pointDef2 = rg.Point3d.Clone( node.get( index2 -1 , "never") )
            pointDef3 = rg.Point3d.Clone( node.get( index3 -1 , "never") )
            pointDef4 = rg.Point3d.Clone( node.get( index4 -1 , "never") )
            pointDef5 = rg.Point3d.Clone( node.get( index5 -1 , "never") )
            pointDef6 = rg.Point3d.Clone( node.get( index6 -1 , "never") )
            pointDef7 = rg.Point3d.Clone( node.get( index7 -1 , "never") )
            pointDef8 = rg.Point3d.Clone( node.get( index8 -1 , "never") )
            vectortrasl1 = rg.Transform.Translation( rg.Vector3d(trasl1.X, trasl1.Y, trasl1.Z)*scaleDef )
            pointDef1.Transform( vectortrasl1 )
            vectortrasl2 = rg.Transform.Translation( rg.Vector3d(trasl2.X, trasl2.Y, trasl2.Z)*scaleDef )
            pointDef2.Transform( vectortrasl2 )
            vectortrasl3 = rg.Transform.Translation( rg.Vector3d(trasl3.X, trasl3.Y, trasl3.Z)*scaleDef )
            pointDef3.Transform( vectortrasl3 )
            vectortrasl4 = rg.Transform.Translation( rg.Vector3d(trasl4.X, trasl4.Y, trasl4.Z)*scaleDef )
            pointDef4.Transform( vectortrasl4 )
            vectortrasl5 = rg.Transform.Translation( rg.Vector3d(trasl5.X, trasl5.Y, trasl5.Z)*scaleDef )
            pointDef5.Transform( vectortrasl1 )
            vectortrasl6 = rg.Transform.Translation( rg.Vector3d(trasl6.X, trasl6.Y, trasl6.Z)*scaleDef )
            pointDef6.Transform( vectortrasl2 )
            vectortrasl7 = rg.Transform.Translation( rg.Vector3d(trasl7.X, trasl7.Y, trasl7.Z)*scaleDef )
            pointDef7.Transform( vectortrasl3 )
            vectortrasl8 = rg.Transform.Translation( rg.Vector3d(trasl8.X, trasl8.Y, trasl8.Z)*scaleDef )
            pointDef8.Transform( vectortrasl4 )
            
            shellDefModel = rg.Mesh()
            shellDefModel.Vertices.Add( pointDef1 ) #0
            shellDefModel.Vertices.Add( pointDef2 ) #1
            shellDefModel.Vertices.Add( pointDef3 ) #2
            shellDefModel.Vertices.Add( pointDef4 ) #3
            shellDefModel.Vertices.Add( pointDef5 ) #4
            shellDefModel.Vertices.Add( pointDef6 ) #5
            shellDefModel.Vertices.Add( pointDef7 ) #6
            shellDefModel.Vertices.Add( pointDef8 ) #7
    
            shellDefModel.Faces.AddFace(0, 1, 2, 3)
            shellDefModel.Faces.AddFace(4, 5, 6, 7)
            shellDefModel.Faces.AddFace(0, 1, 5, 4)
            shellDefModel.Faces.AddFace(1, 2, 6, 5)
            shellDefModel.Faces.AddFace(2, 3, 7, 6)
            shellDefModel.Faces.AddFace(3, 0, 4, 7)
            
            colour = rs.CreateColor( color[0], color[1], color[2] )
            shellDefModel.VertexColors.CreateMonotoneMesh( colour )
            return  [shellDefModel,[trasl1, trasl2, trasl3,trasl4, trasl5, trasl6, trasl7, trasl8 ]]
    
        def defTetraSolid( ele, node, nodeDisp, scaleDef ):
            
            eleTag = ele[0]
            eleNodeTag = ele[1]
            color = ele[2][1]
            #print( eleNodeTag )
            index1 = eleNodeTag[0]
            index2 = eleNodeTag[1]
            index3 = eleNodeTag[2]
            index4 = eleNodeTag[3]
            
            trasl1 = nodeDisp.get( index1 -1 , "never")
            trasl2 = nodeDisp.get( index2 -1 , "never")
            trasl3 = nodeDisp.get( index3 -1 , "never")
            trasl4 = nodeDisp.get( index4 -1 , "never")
            
            ## CREO IL MODELLO DEFORMATO  ##
            pointDef1 = rg.Point3d.Clone( node.get( index1 -1 , "never") )
            pointDef2 = rg.Point3d.Clone( node.get( index2 -1 , "never") )
            pointDef3 = rg.Point3d.Clone( node.get( index3 -1 , "never") )
            pointDef4 = rg.Point3d.Clone( node.get( index4 -1 , "never") )
            
            vectortrasl1 = rg.Transform.Translation( rg.Vector3d(trasl1.X, trasl1.Y, trasl1.Z)*scaleDef )
            pointDef1.Transform( vectortrasl1 )
            vectortrasl2 = rg.Transform.Translation( rg.Vector3d(trasl2.X, trasl2.Y, trasl2.Z)*scaleDef )
            pointDef2.Transform( vectortrasl2 )
            vectortrasl3 = rg.Transform.Translation( rg.Vector3d(trasl3.X, trasl3.Y, trasl3.Z)*scaleDef )
            pointDef3.Transform( vectortrasl3 )
            vectortrasl4 = rg.Transform.Translation( rg.Vector3d(trasl4.X, trasl4.Y, trasl4.Z)*scaleDef )
            pointDef4.Transform( vectortrasl4 )
    
            shellDefModel = rg.Mesh()
            shellDefModel.Vertices.Add( pointDef1 ) #0
            shellDefModel.Vertices.Add( pointDef2 ) #1
            shellDefModel.Vertices.Add( pointDef3 ) #2
            shellDefModel.Vertices.Add( pointDef4 ) #3
            
            
            shellDefModel.Faces.AddFace( 0, 1, 2 )
            shellDefModel.Faces.AddFace( 0, 1, 3 )
            shellDefModel.Faces.AddFace( 1, 2, 3 )
            shellDefModel.Faces.AddFace( 0, 2, 3 )
            colour = rs.CreateColor( color[0], color[1], color[2] )
            shellDefModel.VertexColors.CreateMonotoneMesh( colour )
            
            return  [shellDefModel,[trasl1, trasl2, trasl3, trasl4]]
        ## node e nodeDisp son dictionary ##
        def defValueTimoshenkoBeam( ele, node, nodeDisp, scaleDef ):
            #---------------- WORLD PLANE ----------------------#
            WorldPlane = rg.Plane.WorldXY
            #--------- Propriety TimoshenkoBeam  ----------------#
            TagEle = ele[0]
            propSection = ele[2]
            indexStart = ele[1][0]
            indexEnd = ele[1][1]
            color = propSection[12]
            E = propSection[1]
            G = propSection[2]
            A = propSection[3]
            Avz = propSection[4]
            Avy = propSection[5]
            Jxx = propSection[6]
            Iy = propSection[7]
            Iz = propSection[8]
            #---- traslation and rotation index start & end ------- #
            traslStart = nodeDisp.get( indexStart -1 , "never")[0]
            rotateStart = nodeDisp.get( indexStart -1 , "never")[1]
            traslEnd = nodeDisp.get( indexEnd -1 , "never")[0]
            rotateEnd = nodeDisp.get( indexEnd -1 , "never")[1]
            ##-------------------------------------------- ------------##
            pointStart = node.get( indexStart -1 , "never")
            pointEnd = node.get( indexEnd -1 , "never")
            line = rg.LineCurve( pointStart, pointEnd )
            #-------------------------versor ---------------------------#
            axis1 =  rg.Vector3d( propSection[9][0][0], propSection[9][0][1], propSection[9][0][2]  )
            axis2 =  rg.Vector3d( propSection[9][1][0], propSection[9][1][1], propSection[9][1][2]  )
            axis3 =  rg.Vector3d( propSection[9][2][0], propSection[9][2][1], propSection[9][2][2]  )
            versor = [ axis1, axis2, axis3 ] 
            #---------- WORLD PLANE on point start of line ---------------#
            traslPlane = rg.Transform.Translation( pointStart.X, pointStart.Y, pointStart.Z )
            WorldPlane.Transform( traslPlane )
            #-------------------------------------------------------------#
            planeStart = rg.Plane(pointStart, axis1, axis2 )
            #planeStart = rg.Plane(pointStart, axis3 )
            localPlane = planeStart
            xform = rg.Transform.ChangeBasis( WorldPlane, localPlane )
            localTraslStart = rg.Vector3d( traslStart )
            vectorTrasform = rg.Transform.TransformList( xform, [ traslStart, rotateStart, traslEnd, rotateEnd ] )
            #print( vectorTrasform[0] )
            localTraslStart = vectorTrasform[0]
            uI1 = localTraslStart.X # spostamento in direzione dell'asse rosso 
            uI2 = localTraslStart.Y # spostamento in direzione dell'asse verde
            uI3 = localTraslStart.Z # spostamento linea d'asse
            localRotStart = vectorTrasform[1]
            rI1 = localRotStart.X # 
            rI2 = localRotStart.Y # 
            rI3 = localRotStart.Z # 
            localTraslEnd = vectorTrasform[2]
            uJ1 = localTraslEnd.X # spostamento in direzione dell'asse rosso 
            uJ2 = localTraslEnd.Y # spostamento in direzione dell'asse verde
            uJ3 = localTraslEnd.Z # spostamento linea d'asse
            localRotEnd = vectorTrasform[3]
            rJ1 = localRotEnd[0] #  
            rJ2 = localRotEnd[1]  # 
            rJ3 = localRotEnd[2]  # 
            ##------------------ displacement value -------------------------##
            Length = rg.Curve.GetLength( line )
            segmentCount = Length/0.5
            DivCurve = line.DivideByCount( segmentCount, True )
            if DivCurve == None:
                DivCurve = [ 0, Length]
                
            #s = dg.linspace(0,Length, len(PointsDivLength))
            AlphaY = alphat( E, G, Iy, Avz )
            AlphaZ = alphat( E, G, Iz, Avy )
            
            globalTransVector = []
            globalRotVector = []
            defPoint = []
            defSection = []
            #----------------------- local to global-------------------------#
            xform2 = xform.TryGetInverse()
            #----------------------------------------------------------------#
            for index, x in enumerate(DivCurve):
                beamPoint = line.PointAt(DivCurve[index]) 
                ## SPOSTAMENTO IN DIREZIONE DELL' ASSE 3 ##
                u3 = spostu(x, Length, uI3, uJ3)
                u3Vector = u3*axis3
                ## SPOSTAMENTO IN DIREZIONE DELL' ASSE 1 ##
                v1 =  spostv(x, Length, uI1, uJ1, rI2, rJ2, AlphaY)
                v1Vector = v1*axis1 
                ## SPOSTAMENTO IN DIREZIONE DELL' ASSE 2 ##
                v2 =  spostw(x, Length, uI2, uJ2, rI1, rJ1, AlphaZ)
                v2Vector = v2*axis2 
                
                ## RISULTANTE SPOSTAMENTI ##
                transResult = v1Vector + v2Vector + u3Vector
                
                r2x =  thetaz(x, Length, uI1, uJ1, rI2, rJ2, AlphaY)
                r1x =  psiy(x, Length, uI2, uJ2, rI1, rJ1, AlphaZ)
                r3x = phix(x, Length, rI3, rJ3)
                
                rotResult = r1x*axis1 + r2x*axis2 + r3x*axis3
                
                trasl = rg.Transform.Translation( transResult*scaleDef )
                beamPoint.Transform( trasl )
                defPoint.append( beamPoint )
                
                sectionPlane = rg.Plane( beamPoint, axis1, axis2 )
                sectionPlane.Rotate( scaleDef*r1x, axis1, beamPoint )
                sectionPlane.Rotate( scaleDef*r2x, axis2, beamPoint )
                sectionPlane.Rotate( scaleDef*r3x, axis3, beamPoint )
                if dimSection[0] == 'rectangular' :
                    width, height = dimSection[1], dimSection[2]
                    section = AddRectangleFromCenter( sectionPlane, width, height )
                    defSection.append( section )
                elif dimSection[0] == 'circular' :
                    radius1  = dimSection[1]/2
                    radius2  = dimSection[1]/2 - dimSection[2]
                    section1 = AddCircleFromCenter( sectionPlane, radius1 )
                    if (radius1 - radius2 ) == 0 :
                        defSection.append( section1 )
                    else :
                        section2 = AddCircleFromCenter( sectionPlane, radius2 )
                        defSection.append( [ section1, section2 ] )
                elif dimSection[0] == 'doubleT' :
                    Bsup = dimSection[1]
                    tsup = dimSection[2]
                    Binf = dimSection[3]
                    tinf = dimSection[4]
                    H =  dimSection[5]
                    ta =  dimSection[6]
                    yg =  dimSection[7]
                    section = AddIFromCenter( sectionPlane, Bsup, tsup, Binf, tinf, H, ta, yg )
                    defSection.append( section )
                elif dimSection[0] == 'Generic' :
                    radius  = dimSection[1]
                    section = AddCircleFromCenter( sectionPlane, radius )
                    defSection.append( section )
            
                globalTrasl = rg.Vector3d( transResult ) 
                globalTrasl.Transform(xform2[1]) 
                globalTrasl.Transform(xform)
                globalTransVector.append( globalTrasl )
    
           
            defpolyline = rg.PolylineCurve( defPoint )
    
            if dimSection[0] == 'circular' :
                radius1  = dimSection[1]/2
                radius2  = dimSection[1]/2 - dimSection[2]
                if (radius1 - radius2 ) == 0:
                    meshdef = meshLoft3( defSection,  color )
    
                else :
                    defSection1 = [row[0] for row in defSection ]
                    defSection2 = [row[1] for row in defSection ]
                    meshdef = meshLoft3( defSection1,  color )
                    meshdef.Append( meshLoft3( defSection2,  color ) )
                    print( meshdef )
    
            else  :
                meshdef = meshLoft3( defSection,  color )
            return  [  defpolyline, meshdef ,  globalTransVector, globalRotVector ] 
    
        ## node e nodeDisp son dictionary ##
        def defTruss( ele, node, nodeDisp, scale ):
            WorldPlane = rg.Plane.WorldXY
            TagEle = ele[0]
            propSection = ele[2]
            color = propSection[12]
            indexStart = ele[1][0]
            indexEnd = ele[1][1]
            E = propSection[1]
            A = propSection[3]
            
            traslStart = nodeDisp.get( indexStart -1 , "never")
            traslEnd = nodeDisp.get( indexEnd -1 , "never")
            if len( traslStart ) == 2:
                traslStart = nodeDisp.get( indexStart -1 , "never")[0]
                traslEnd = nodeDisp.get( indexEnd -1 , "never")[0]
            pointStart = node.get( indexStart -1 , "never")
            pointEnd = node.get( indexEnd -1 , "never")
            #print( traslStart[1] )
            line = rg.LineCurve( pointStart,  pointEnd )
    
            axis1 =  rg.Vector3d( propSection[9][0][0], propSection[9][0][1], propSection[9][0][2]  )
            axis2 =  rg.Vector3d( propSection[9][1][0], propSection[9][1][1], propSection[9][1][2]  )
            axis3 =  rg.Vector3d( propSection[9][2][0], propSection[9][2][1], propSection[9][2][2]  )
            versor = [ axis1, axis2, axis3 ] 
            #---------- WORLD PLANE on point start of line ---------------#
            traslPlane = rg.Transform.Translation( pointStart.X, pointStart.Y, pointStart.Z )
            WorldPlane.Transform( traslPlane )
            #-------------------------------------------------------------#
            planeStart = rg.Plane(pointStart, axis1, axis2 )
            #planeStart = rg.Plane(pointStart, axis3 )
            localPlane = planeStart
            xform = rg.Transform.ChangeBasis( WorldPlane, localPlane )
            localTraslStart = rg.Vector3d( traslStart )
            vectorTrasform = rg.Transform.TransformList( xform, [ traslStart , traslEnd ] )
            #print( vectorTrasform[0] )
            localTraslStart = vectorTrasform[0]
            uI1 = localTraslStart.X # spostamento in direzione dell'asse rosso 
            uI2 = localTraslStart.Y # spostamento in direzione dell'asse verde
            uI3 = localTraslStart.Z # spostamento linea d'asse
            localTraslEnd = vectorTrasform[1]
            uJ1 = localTraslEnd.X # spostamento in direzione dell'asse rosso 
            uJ2 = localTraslEnd.Y # spostamento in direzione dell'asse verde
            uJ3 = localTraslEnd.Z # spostamento linea d'asse
            ##-------------- displacement value -------------------------##
            Length = rg.Curve.GetLength( line )
            segmentCount = Length/0.5
            DivCurve = line.DivideByCount( segmentCount, True )
            if DivCurve == None:
                DivCurve = [ 0, Length]
            defPoint = []
            defSection = []
            globalTransVector = []
            #----------------------- local to global-------------------------#
            xform2 = xform.TryGetInverse()
            #----------------------------------------------------------------#
            for index, x in enumerate(DivCurve):
                beamPoint = line.PointAt(DivCurve[index]) 
                ## SPOSTAMENTO IN DIREZIONE DELL' ASSE 3 ##
                u3 = spostu(x, Length, uI3, uJ3)
                u3Vector = u3*axis3
                ## SPOSTAMENTO IN DIREZIONE DELL' ASSE 1 ##
                v1 =  x*( uJ1 - uI1 )/Length + uI1
                v1Vector = v1*axis1 
                ## SPOSTAMENTO IN DIREZIONE DELL' ASSE 2 ##
                v2 =  x*( uJ2 - uI2 )/Length + uI2
                v2Vector = v2*axis2 
                ## RISULTANTE SPOSTAMENTI ##
                transResult = v1Vector + v2Vector + u3Vector
                trasl = rg.Transform.Translation( transResult*scale )
                beamPoint.Transform( trasl )
                defPoint.append( beamPoint )
                sectionPlane = rg.Plane( beamPoint, axis1, axis2 )
                if dimSection[0] == 'rectangular' :
                    width, height = dimSection[1], dimSection[2]
                    section = AddRectangleFromCenter( sectionPlane, width, height )
                    defSection.append( section )
                elif dimSection[0] == 'circular' :
                    radius1  = dimSection[1]/2
                    radius2  = dimSection[1]/2 - dimSection[2]
                    section1 = AddCircleFromCenter( sectionPlane, radius1 )
                    if (radius1 - radius2 ) == 0 :
                        defSection.append( section1 )
                    else :
                        section2 = AddCircleFromCenter( sectionPlane, radius2 )
                        defSection.append( [ section1, section2 ] )
                elif dimSection[0] == 'doubleT' :
                    Bsup = dimSection[1]
                    tsup = dimSection[2]
                    Binf = dimSection[3]
                    tinf = dimSection[4]
                    H =  dimSection[5]
                    ta =  dimSection[6]
                    yg =  dimSection[7]
                    section = AddIFromCenter( sectionPlane, Bsup, tsup, Binf, tinf, H, ta, yg )
                    defSection.append( section )
                elif dimSection[0] == 'Generic' :
                    radius  = dimSection[1]
                    section = AddCircleFromCenter( sectionPlane, radius )
                    defSection.append( section )
            
                globalTrasl = rg.Vector3d( transResult ) 
                globalTrasl.Transform(xform2[1]) 
                globalTrasl.Transform(xform)
                globalTransVector.append( globalTrasl )
    
           
            defpolyline = rg.PolylineCurve( defPoint )
    
            if dimSection[0] == 'circular' :
                radius1  = dimSection[1]/2
                radius2  = dimSection[1]/2 - dimSection[2]
                if (radius1 - radius2 ) == 0:
                    meshdef = meshLoft3( defSection,  color )
    
                else :
                    defSection1 = [row[0] for row in defSection ]
                    defSection2 = [row[1] for row in defSection ]
                    meshdef = meshLoft3( defSection1,  color )
                    meshdef.Append( meshLoft3( defSection2,  color ) )
                    #print( meshdef )
    
            else  :
                meshdef = meshLoft3( defSection,  color )
            return  [ defpolyline, meshdef, globalTransVector] 
        ## Mesh from close section eith gradient color ##
        def meshLoft3( point, color ):
            #print( point )
            meshEle = rg.Mesh()
            pointSection1 = point
            for i in range(0,len(pointSection1)):
                for j in range(0, len(pointSection1[0])):
                    vertix = pointSection1[i][j]
                    #print( type(vertix) )
                    meshEle.Vertices.Add( vertix ) 
                    #meshEle.VertexColors.Add( color[0],color[1],color[2] );
            k = len(pointSection1[0])
            for i in range(0,len(pointSection1)-1):
                for j in range(0, len(pointSection1[0])):
                    if j < k-1:
                        index1 = i*k + j
                        index2 = (i+1)*k + j
                        index3 = index2 + 1
                        index4 = index1 + 1
                    elif j == k-1:
                        index1 = i*k + j
                        index2 = (i+1)*k + j
                        index3 = (i+1)*k
                        index4 = i*k
                    meshEle.Faces.AddFace(index1, index2, index3, index4)
                    #rs.ObjectColor(scyl,(255,0,0))
            colour = rs.CreateColor( color[0], color[1], color[2] )
            meshEle.VertexColors.CreateMonotoneMesh( colour )
            meshElement = meshEle
            #meshdElement.IsClosed(True)
            
            return meshElement
    
        def gradient(value, valueMin, valueMax, colorList ):
    
            if colorList == [] :
                listcolor = [ rs.CreateColor( 201, 0, 0 ),
                            rs.CreateColor( 240, 69, 7),
                            rs.CreateColor( 251, 255, 0 ),
                            rs.CreateColor( 77, 255, 0 ),
                            rs.CreateColor( 0, 255, 221 ),
                            rs.CreateColor( 0, 81, 255 )]
            else :
                listcolor = colorList
    
            n = len( listcolor )
            domain = linspace( valueMin, valueMax, n)
            #print( domain )
            
            for i in range(1,n+1):
                if  domain[i-1] <= value <= domain[i] :
                    return listcolor[ i-1 ]
                elif  valueMax <= value <= valueMax + 0.0000000000001 :
                    return listcolor[ -1 ]
                elif  valueMin - 0.0000000000001 <= value <= valueMin  :
                    return listcolor[ 0 ]
                    
        def updateComponent(interval):
            
            ## Updates this component, similar to using a grasshopper timer 
            
            # Define callback action
            def callBack(e):
                ghenv.Component.ExpireSolution(False)
            
            # Get grasshopper document
            ghDoc = ghenv.Component.OnPingDocument()
            
            # Schedule this component to expire
            ghDoc.ScheduleSolution(interval,gh.Kernel.GH_Document.GH_ScheduleDelegate(callBack)) # Note that the first input here is how often to update the component (in milliseconds)
                
        def ModalView(AlpacaModalOutput, numberMode, speed, Animate, Reset, scale, direction, modelExstrud, colorList ):
        
            global myCounter
            
            
            Animate = False if Animate is None else Animate
            numberMode = 1 if numberMode is None else numberMode
            Reset = True if Reset is None else Reset
            speed = 1 if speed is None else speed
            modelExstrud = True if modelExstrud is None else modelExstrud
                    
                
                
            global ModelDisp
            global ModelCurve
            global ModelShell
            global ModelSolid
            global dimSection
            #global ExtrudedModel
        
            diplacementWrapper = AlpacaModalOutput[0][numberMode-1] # number of mode will start from 1. First, Second, Third ect ect
            EleOut = AlpacaModalOutput[1]
            Period = AlpacaModalOutput[3]
        
        
            # Instantiate/reset persisent starting counter variable
            if "myCounter" not in globals() or Reset :
                myCounter = 0
        
            # Update the variable and component
            if Animate and not Reset:
                myCounter += 1/ ( (speed) * 10 )
                updateComponent(1)
        
            # Output counter
        
            T = Period[numberMode-1]
            w = 2 * mt.pi/T
            #At = math.sin(myCounter)
        
            At = mt.sin(myCounter * w + mt.pi/2)
        
            nodeValue = []
            displacementValue = []
            #ShellOut = AlpacaModalOutput[4]
        
            pointWrapper = []
            dispWrapper = []
        
            for index,item in enumerate(diplacementWrapper):
                nodeValue.append( item[0] )
                displacementValue.append( item[1] )
                pointWrapper.append( [index, rg.Point3d(item[0][0],item[0][1],item[0][2]) ] )
                if len(item[1]) == 3:
                    dispWrapper.append( [index, rg.Point3d( item[1][0], item[1][1], item[1][2] ) ] )
                elif len(item[1]) == 6:
                    dispWrapper.append( [index, [rg.Point3d(item[1][0],item[1][1],item[1][2] ), rg.Point3d(item[1][3],item[1][4],item[1][5]) ] ] )
        
            ## Dict. for point ##
            pointWrapperDict = dict( pointWrapper )
            pointDispWrapperDict = dict( dispWrapper )
            ####
        
            ## FOR scala automatica ##
            ## nodeValue è la lista delle cordinate
            rowX = [row[0] for row in nodeValue ]
            rowY = [row[1] for row in nodeValue ]
            rowZ = [row[2] for row in nodeValue ]
        
            scaleMax = max( max(rowX), max(rowY), max(rowZ) )
            scaleMin = min( min(rowX), min(rowY), min(rowZ) )
            coordMax = max( mt.fabs(scaleMin),mt.fabs(scaleMax)) - mt.fabs(scaleMin)
        
            ## displacementValue è la lista degli spostamenti
        
            rowDefX = [row[0] for row in displacementValue ]
            rowDefY = [row[1] for row in displacementValue ]
            rowDefZ = [row[2] for row in displacementValue ]
        
            defMax = max( max(rowDefX), max(rowDefY), max(rowDefZ) )
            defMin = min( min(rowDefX), min(rowDefY), min(rowDefZ) )
            DefMax = max( mt.fabs(defMax),mt.fabs(defMin))
        
            if scale is None:
                scaleDef = scaleAutomatic( coordMax , DefMax )/10
        
            else :
                scaleDef = scale
        
            modelDisp = []
            modelCurve = []
            ShellDefModel = []
            ExtrudedView = []
        
            traslBeamValue = []
            rotBeamValue = []
        
            traslShellValue = []
            rotShellValue = []
            ExtrudedShell = []
        
            SolidDefModel = []
            traslSolidValue = []
        
        
            for ele in EleOut :
                eleType = ele[2][0]
                nNode = len( ele[1] )
                
                if eleType == 'ElasticTimoshenkoBeam' :
                    
                    dimSection = ele[2][10]
                    color = ele[2][12]
                    valueTBeam = defValueTimoshenkoBeam( ele, pointWrapperDict, pointDispWrapperDict, scaleDef*At )
                    defpolyline = valueTBeam[0]
                    meshdef = valueTBeam[1]
                    globalTrans = valueTBeam[2]
                    globalRot = valueTBeam[3]
                    traslBeamValue.append( globalTrans ) 
                    rotBeamValue.append( globalRot )
                    modelCurve.append( defpolyline )
                    modelDisp.append( defpolyline )
                    # estrusione della beam #
                    ExtrudedView.append( meshdef )
                elif eleType == 'Truss' :
                    dimSection = ele[2][10]
                    color = ele[2][12]
                    #print( color )
                    valueTruss = defTruss( ele, pointWrapperDict, pointDispWrapperDict, scaleDef*At )
                    defpolyline = valueTruss[0]
                    meshdef = valueTruss[1]
                    globalTrans = valueTruss[2]
                    traslBeamValue.append( globalTrans ) 
                    modelCurve.append( defpolyline )
                    ExtrudedView.append( meshdef )
                    modelDisp.append( defpolyline )
        
                elif nNode == 4 and eleType != 'FourNodeTetrahedron':
                    shellDefModel = defShellQuad( ele, pointWrapperDict, pointDispWrapperDict, scaleDef*At )
                    ShellDefModel.append( shellDefModel[0] )
                    traslShellValue.append( shellDefModel[1] )
                    rotShellValue.append( shellDefModel[2] )
                    extrudeShell = shellDefModel[3]
                    ExtrudedView.append( extrudeShell )
                    
                elif nNode == 3:
                    #print( nNode )
                    shellDefModel = defShellTriangle( ele, pointWrapperDict, pointDispWrapperDict, scaleDef*At )
                    ShellDefModel.append( shellDefModel[0] )
                    traslShellValue.append( shellDefModel[1] )
                    rotShellValue.append( shellDefModel[2] )
                    extrudeShell = shellDefModel[3]
                    ExtrudedView.append( extrudeShell )
        
                    
                elif nNode == 8:
                    solidDefModel = defSolid( ele, pointWrapperDict, pointDispWrapperDict, scaleDef*At )
                    SolidDefModel.append( solidDefModel[0] )
                    doc.Objects.AddMesh( solidDefModel[0] )
                    traslSolidValue.append( solidDefModel[1] )
                    ExtrudedView.append( solidDefModel[0] )
                    
                elif  eleType == 'FourNodeTetrahedron' :
                    #print(ele)
                    solidDefModel = defTetraSolid( ele, pointWrapperDict, pointDispWrapperDict, scaleDef*At )
                    SolidDefModel.append( solidDefModel[0] )
                    traslSolidValue.append( solidDefModel[1] )
                    ExtrudedView.append( solidDefModel[0] )
        
            ########################################################################################################################
            # MAX an MIN VALOR
            valorVector = []
            # beam valor #
            for valuetrasl in traslBeamValue:
                for valor in valuetrasl:
                    vectorTrasl = rg.Vector3d( valor )
                    if direction == 0:
                        valorVector.append( vectorTrasl.X ) 
                    elif direction == 1:
                        valorVector.append( vectorTrasl.Y )
                    elif direction == 2:
                        valorVector.append( vectorTrasl.Z ) 
                    elif direction == 3:
                        valorVector.append( vectorTrasl.Length )     
            # POINT #
            if len(dispWrapper[0][1]) == 3 :
                PointDisp = [row[1] for row in dispWrapper ] 
            else:
                PointDisp = [row[1][0] for row in dispWrapper ]
        
            for nodeDisp in PointDisp :
                vectorNodeDisp = rg.Vector3d( nodeDisp )
                if direction == 0:
                    valorVector.append( vectorNodeDisp.X ) 
                elif direction == 1:
                    valorVector.append( vectorNodeDisp.Y )
                elif direction == 2:
                    valorVector.append( vectorNodeDisp.Z ) 
                elif direction == 3:
                    valorVector.append( vectorNodeDisp.Length )
            # MAX end MIN on structures point #
            lowerLimit = min( valorVector )
            upperLimit = max( valorVector )
            domainValues = [ lowerLimit, upperLimit ]
            print( lowerLimit, upperLimit )
        #####################################################################################
            colorBeam = []
            numberDivide = []
            for value in traslBeamValue :
                colorValor = []
                for valor in value:
                    vectorTrasl = rg.Vector3d( valor )
        
                    if direction == 0:
                        valorVector = vectorTrasl.X  
                    elif direction == 1:
                        valorVector = vectorTrasl.Y 
                    elif direction == 2:
                        valorVector = vectorTrasl.Z  
                    elif direction == 3:
                        valorVector = vectorTrasl.Length
        
                    #print( valorVector )
        
                    color = gradient( valorVector, lowerLimit, upperLimit, colorList )
                    colorValor.append( color )
                colorBeam.append( colorValor )
                numberDivide.append( len(colorValor) )
            #print( modelCurve[0])
            segment = []
            for curve, segmentCount in zip( modelCurve, numberDivide ):
                #print(segmentCount)
                parameter = curve.DivideByCount( segmentCount - 1, True )
                segmentCurve = []
                for i in range(1, len(parameter)) :
                        p1 =  rg.Curve.PointAt( curve, parameter[i-1] ) 
                        p2 = rg.Curve.PointAt( curve, parameter[i] )
                        segmentCurve.append( rg.Line( p1, p2 ) )
                segment.append( segmentCurve )
        
                #print( segment )
        
            
            for shellEle, value in zip(ShellDefModel,traslShellValue) :
                shellColor = shellEle.DuplicateMesh()
                shellColor.VertexColors.Clear()
                for j in range( 0,shellEle.Vertices.Count ):
                    vectorTrasl = rg.Vector3d( value[j] )
                    if direction == 0:
                        valorVector = vectorTrasl.X  
                    elif direction == 1:
                        valorVector = vectorTrasl.Y 
                    elif direction == 2:
                        valorVector = vectorTrasl.Z  
                    elif direction == 3:
                        valorVector = vectorTrasl.Length
        
                    color = gradient( valorVector, lowerLimit, upperLimit, colorList )
                    shellColor.VertexColors.Add( color )
                modelDisp.append( shellColor)
            #dup.VertexColors.CreateMonotoneMesh(Color.Red)
            #doc.Objects.AddMesh(dup)
            for solidEle, value in zip(SolidDefModel,traslSolidValue) :
                solidColor = solidEle.DuplicateMesh()
                solidColor.VertexColors.Clear()
                for j in range(0,solidEle.Vertices.Count):
                    vectorTrasl = rg.Vector3d( value[j] )
                    if direction == 0:
                        valorVector = vectorTrasl.X  
                    elif direction == 1:
                        valorVector = vectorTrasl.Y 
                    elif direction == 2:
                        valorVector = vectorTrasl.Z  
                    elif direction == 3:
                        valorVector = vectorTrasl.Length
        
                    color = gradient( valorVector, lowerLimit, upperLimit, colorList )
                    solidColor.VertexColors.Add( color )
                modelDisp.append( solidColor )
                    #rg.Collections.MeshVertexColorList.SetColor( solidEle,j, color[0], color[1], color[2] )
        
        
            if modelExstrud == False or modelExstrud == None :
                self.line = segment
                self.colorLine = colorBeam
                return modelDisp, domainValues
                
            else:
                self.line = []
                self.colorLine = []
                return ExtrudedView, domainValues
                
                
                
        checkData = True
        
        if not AlpacaModalOutput:
            checkData = False
            msg = "input 'AlpacaModalOutput' failed to collect data"
            ghenv.Component.AddRuntimeMessage(gh.Kernel.GH_RuntimeMessageLevel.Warning, msg)
        
        if checkData != False:
            modelDisp, domainValues = ModalView(AlpacaModalOutput, numberMode, speed, Animate, Reset, scale, direction,modelExstrud, colorList )
            return (modelDisp, domainValues)
            
    def DrawViewportWires(self,arg):
        
        for crvs, colors in zip(self.line, self.colorLine):
            for crv, color in zip(crvs, colors):
                arg.Display.DrawLine(crv, color, 4)
# ---------- end ghpython_script_2 ----------

# ---- group: spectral
merge_11 = Merge(
    Data1=ColourSwatch(SwatchColor=RGB(201, 0, 0)),
    Data2=ColourSwatch(SwatchColor=RGB(240, 69, 7)),
    Data3=ColourSwatch(SwatchColor=RGB(251, 255, 0)),
    Data4=ColourSwatch(SwatchColor=RGB(77, 255, 0)),
    Data5=ColourSwatch(SwatchColor=RGB(0, 153, 28)),
    Data6=ColourSwatch(SwatchColor=RGB(67, 136, 247)),
    Data7=ColourSwatch(SwatchColor=RGB(0, 30, 255)),
    Data8=ColourSwatch(SwatchColor=RGB(111, 0, 176)))

# ----
geometry_2 = Geometry(ghpython_script_2.modelDisp)
geometry_3 = Geometry(python_28.modelDisp)

# ---- group: brick Displacement
python_30 = GhPythonScript(Code=read_file_23)  # -> Out, TagElement, Trans; disabled

# ---- group: Shell Displacement
python_31 = GhPythonScript(Code=read_file_21, AlpacaStaticOutput=analyze.AlpacaStaticOutput)  # -> Out, TagElement, Trans, Rot; disabled

# ---- group: Beam Displacement
python_32 = GhPythonScript(Code=read_file_20, AlpacaStaticOutput=analyze.AlpacaStaticOutput, NumberResults=number_slider_5)  # -> Out, TagElement, LocalTrans, LocalRot, GlobalTrans, GlobalRot; disabled

# ---- group: NodeDisp
python_33 = GhPythonScript(Code=read_file_22, AlpacaStaticOutput=merge_2)  # -> Out, Points, Trans, Rot; disabled

# ---- group: spectral
merge_12 = Merge(
    Data1=ColourSwatch(SwatchColor=RGB(201, 0, 0)),
    Data2=ColourSwatch(SwatchColor=RGB(240, 69, 7)),
    Data3=ColourSwatch(SwatchColor=RGB(251, 255, 0)),
    Data4=ColourSwatch(SwatchColor=RGB(77, 255, 0)),
    Data5=ColourSwatch(SwatchColor=RGB(0, 153, 28)),
    Data6=ColourSwatch(SwatchColor=RGB(67, 136, 247)),
    Data7=ColourSwatch(SwatchColor=RGB(0, 30, 255)),
    Data8=ColourSwatch(SwatchColor=RGB(111, 0, 176)))

# ----
panel_22 = Panel(python_23.Mz)  # disabled

# ----
# OK!
file_path_24 = FilePath("C:\GitHub\Alpaca4d\PythonScript\Post-Processing\disassembleModel\disassembleModel.py")
read_file_24 = ReadFile(File=file_path_24, PerLineParse=False)

# ---- group: disassemble Model
python_34 = GhPythonScript(Code=read_file_24, AlpacaModel=python_19.AlpacaModel)  # -> Element, ExtrudedElement, Points, Support, Load, Material, Section

# ----
panel_23 = Panel(python_34.ExtrudedElement)

# ==== cluster Cluster
tree = ClusterInput()
tree_2 = ClusterInput()
gate = ClusterInput()
tree_3 = ClusterInput()
tree_statistics = TreeStatistics(Tree=tree_2)  # -> Paths, Length, Count
tree_statistics_2 = TreeStatistics(Tree=tree)  # -> Paths, Length, Count
cull_index = CullIndex(List=tree_statistics.Paths, Indices="0", Wrap=True)
tree_statistics_3 = TreeStatistics(Tree=tree_3)  # -> Paths, Length, Count
construct_path = ConstructPath(Indices="0")
cull_index_2 = CullIndex(List=tree_statistics_2.Paths, Indices="0", Wrap=True)
construct_path_2 = ConstructPath(Indices="0")
cull_index_3 = CullIndex(List=tree_statistics_3.Paths, Indices="0", Wrap=True)
tree_branch = TreeBranch(Tree=tree_2, Path=construct_path, MaintainPaths=True)
tree_branch_2 = TreeBranch(Tree=tree_2, Path=cull_index, MaintainPaths=True)
construct_path_3 = ConstructPath(Indices="0")
tree_branch_3 = TreeBranch(Tree=tree, Path=construct_path_2, MaintainPaths=True)
tree_branch_4 = TreeBranch(Tree=tree, Path=cull_index_2, MaintainPaths=True)
list_length = ListLength(List=tree_branch_2)
tree_branch_5 = TreeBranch(Tree=tree_3, Path=construct_path_3, MaintainPaths=True)
tree_branch_6 = TreeBranch(Tree=tree_3, Path=cull_index_3, MaintainPaths=True)
deconstruct_vector = DeconstructVector(Vector=tree_branch_4)  # -> XComponent, YComponent, ZComponent
vector_length = VectorLength(Vector=tree_branch_4)
divide_curve = DivideCurve(Curve=tree_branch, Count=flatten(list_length), Kinks=False)  # -> Points, Tangents, simplify(Parameters)
deconstruct_vector_2 = DeconstructVector(Vector=tree_branch_6)  # -> XComponent, YComponent, ZComponent
vector_length_2 = VectorLength(Vector=tree_branch_6)
stream_filter = StreamFilter(
    Gate=gate,
    Stream0=deconstruct_vector.XComponent,
    Stream1=deconstruct_vector.YComponent,
    Stream2=deconstruct_vector.ZComponent,
    Stream3=vector_length)
stream_filter_2 = StreamFilter(
    Gate=gate,
    Stream0=deconstruct_vector_2.XComponent,
    Stream1=deconstruct_vector_2.YComponent,
    Stream2=deconstruct_vector_2.ZComponent,
    Stream3=vector_length_2)
deconstruct_vector_3 = DeconstructVector(Vector=tree_branch_2)  # -> XComponent, YComponent, ZComponent
vector_length_3 = VectorLength(Vector=tree_branch_2)
merge = Merge(Data1=tree_branch_2, Data2=tree_branch_4, Data3=tree_branch_6)  # -> flatten(Result)
deconstruct_vector_4 = DeconstructVector(Vector=merge)  # -> XComponent, YComponent, ZComponent
stream_filter_3 = StreamFilter(
    Gate=gate,
    Stream0=deconstruct_vector_3.XComponent,
    Stream1=deconstruct_vector_3.YComponent,
    Stream2=deconstruct_vector_3.ZComponent,
    Stream3=vector_length_3)
vector_length_4 = VectorLength(Vector=merge)
stream_filter_4 = StreamFilter(
    Gate=gate,
    Stream0=deconstruct_vector_4.XComponent,
    Stream1=deconstruct_vector_4.YComponent,
    Stream2=deconstruct_vector_4.ZComponent,
    Stream3=vector_length_4)
bounds = Bounds(Numbers=flatten(stream_filter_4))
entwine = Entwine(Branch00=stream_filter_3, Branch01=stream_filter, Branch02=stream_filter_2, FlattenInputs=True)  # -> flatten(Result)
deconstruct_domain = DeconstructDomain(Domain=bounds)  # -> Start, End
bounds_2 = Bounds(Numbers=entwine)
shatter = Shatter(Curve=graft(tree_branch), Parameters=divide_curve.Parameters)  # -> simplify(graft(Segments))
domain = ClusterOutput(bounds_2)
gradient = Gradient(
    LowerLimit=deconstruct_domain.Start,
    UpperLimit=deconstruct_domain.End,
    Parameter=stream_filter_3,
    stops=[0.103: RGB(0, 0, 255), 0.22: RGB(0, 170, 255), 0.305: RGB(0, 255, 255), 0.398: RGB(0, 255, 188), 0.504: RGB(0, 255, 106), 0.605: RGB(91, 255, 0), 0.699: RGB(184, 255, 0), 0.799: RGB(255, 255, 0), 0.898: RGB(255, 170, 0)])
gradient_2 = Gradient(
    LowerLimit=deconstruct_domain.Start,
    UpperLimit=deconstruct_domain.End,
    Parameter=stream_filter,
    stops=[0.103: RGB(0, 0, 255), 0.22: RGB(0, 170, 255), 0.305: RGB(0, 255, 255), 0.398: RGB(0, 255, 188), 0.504: RGB(0, 255, 106), 0.605: RGB(91, 255, 0), 0.699: RGB(184, 255, 0), 0.799: RGB(255, 255, 0), 0.898: RGB(255, 170, 0)])
gradient_3 = Gradient(
    LowerLimit=deconstruct_domain.Start,
    UpperLimit=deconstruct_domain.End,
    Parameter=stream_filter_2,
    stops=[0.103: RGB(0, 0, 255), 0.22: RGB(0, 170, 255), 0.305: RGB(0, 255, 255), 0.398: RGB(0, 255, 188), 0.504: RGB(0, 255, 106), 0.605: RGB(91, 255, 0), 0.699: RGB(184, 255, 0), 0.799: RGB(255, 255, 0), 0.898: RGB(255, 170, 0)])
number_slider = Slider(3, range=0..10)
curve = Curve(flatten(shatter))
mesh_colours = MeshColours(Mesh=graft(tree_branch_5), Colours=gradient_3)
mesh_colours_2 = MeshColours(Mesh=graft(tree_branch_3), Colours=gradient_2)
custom_preview = CustomPreview(Geometry=curve, Material=flatten(gradient))

# ==== cluster Cluster_2
y_component = ClusterInput()
x_component = ClusterInput()
B = ClusterInput()
vector_xyz = VectorXYZ(XComponent=x_component, YComponent=y_component, ZComponent=0)  # -> Vector, Length
division = Division(A=vector_xyz.Vector, B=B)
negative = Negative(Value=division)
A = ClusterInput()
addition = Addition(A=A, B=negative)
vector_display_ex = VectorDisplayEx(Point=addition, Vector=division, Colour=ColourSwatch(SwatchColor=RGB(255, 0, 0)), Width=2)
