# Grasshopper definition TestGalapagos.gh (Grasshopper 1.0.7)

abs = Absolute()
division = Division(A=abs, B="0.20")
addition = Addition(A="25", B=division)
division_2 = Division(A=addition, B="9.81")
number_slider = Slider(10, range=0..10)
Z = UnitZ(Factor=number_slider)
planesrf = PlaneSurface(Plane=PlaneXY(0, 0, 0), XSize=Domain(-10, 10), YSize=Domain(-10, 10))
swatch = ColourSwatch(SwatchColor=RGB(240, 0, 0))
move = Move(Geometry=planesrf, Motion=Z)  # -> Geometry, Transform

# ----
# Constant Time Series
# Linear Time Series
python = GhPythonScript(constantFactor="1")  # -> timeSeries, Graph
# ---------- python: Python ----------
"""
Create a PointLoad
-
    Args:
        tStart:
        tEnd:
        period:
        factor:
        shift:
    Returns:
        timeSeries:
        Graph:
"""

import sys
import Rhino.Geometry as rg
import Grasshopper as gh
import copy
import math


## add alpaca install directory to system path

ghcompfolder = gh.Folders.DefaultAssemblyFolder
if ghcompfolder not in sys.path:
    sys.path.append(ghcompfolder)

try:
    from Alpaca4d import alpaca4d as alpaca
except:
    msg = "Cannot import Alpaca4d. Is the Alpaca4d folder available in " + ghcompfolder + "?"
    ghenv.Component.AddRuntimeMessage(gh.Kernel.GH_RuntimeMessageLevel.Error, msg)

def ConstantSeries(x):
    return x



checkData = True

if not constantFactor:
    constantFactor = 1


if checkData:
    timeSeries = alpaca.TimeSeriesConstant(constantFactor)
    
    Graph = []
    
    for x in range(10):
        Graph.append(ConstantSeries(constantFactor))
# ---------- end python ----------
python_2 = GhPythonScript(linearFactor="1")  # -> timeSeries, Graph
# ---------- python_2: Python ----------
"""
Create a PointLoad
-
    Args:
        tStart:
        tEnd:
        period:
        factor:
        shift:
    Returns:
        timeSeries:
        Graph:
"""

import sys
import Rhino.Geometry as rg
import Grasshopper as gh
import copy
import math


## add alpaca install directory to system path

ghcompfolder = gh.Folders.DefaultAssemblyFolder
if ghcompfolder not in sys.path:
    sys.path.append(ghcompfolder)

try:
    from Alpaca4d import alpaca4d as alpaca
except:
    msg = "Cannot import Alpaca4d. Is the Alpaca4d folder available in " + ghcompfolder + "?"
    ghenv.Component.AddRuntimeMessage(gh.Kernel.GH_RuntimeMessageLevel.Error, msg)


def linearSeries(x):
    return x



checkData = True

if not linearFactor:
    linearFactor = 1




if checkData:
    timeSeries = alpaca.TimeSeriesLinear(linearFactor)
    
    Graph = []
    
    for x in range(10):
        Graph.append(linearSeries(x * linearFactor))
# ---------- end python_2 ----------

# ---- group: da MPa a KN/m2
multiplication = Multiplication(A=Slider(30000, range=0..100000), B="1000")

# ----
# nDMaterial
# ElasticIsotropic
python_3 = GhPythonScript(E=multiplication, v="0.3", rho=division_2)  # -> out, nDMaterial
# ---------- python_3: Python ----------
"""
Create a support
-
    Args:
        name:
        E:
        G:
        v:
        rho:
    Returns:
        nDMaterial:
"""


import sys
import Rhino.Geometry as rg
import Grasshopper as gh
import copy


## add alpaca install directory to system path

ghcompfolder = gh.Folders.DefaultAssemblyFolder
if ghcompfolder not in sys.path:
    sys.path.append(ghcompfolder)

try:
    from Alpaca4d import alpaca4d as alpaca
except:
    msg = "Cannot import Alpaca4d. Is the Alpaca4d folder available in " + ghcompfolder + "?"
    ghenv.Component.AddRuntimeMessage(gh.Kernel.GH_RuntimeMessageLevel.Error, msg)


checkData = True

if not E:
    checkData = False
    msg = "Input parameter E failed to collect data"
    ghenv.Component.AddRuntimeMessage(gh.Kernel.GH_RuntimeMessageLevel.Warning, msg)

if not G and not v:
    checkData = False
    msg = "Input parameter G or v failed to collect data"
    ghenv.Component.AddRuntimeMessage(gh.Kernel.GH_RuntimeMessageLevel.Warning, msg)

if not rho:
    checkData = False
    msg = "Input parameter rho failed to collect data"
    ghenv.Component.AddRuntimeMessage(gh.Kernel.GH_RuntimeMessageLevel.Warning, msg)

if checkData:
    nDMaterial = alpaca.ElasticIsotropic(name, E, G, rho, v)
# ---------- end python_3 ----------

# ----
# Plate Fiber Section
python_4 = GhPythonScript(thickness="0.20", nDMaterial=python_3.nDMaterial)  # -> out, fiberSection
# ---------- python_4: Python ----------
"""
Create a support
-
    Args:
        secName:
        thickness:
        nDMaterial:
    Returns:
        fiberSection:
"""


import sys
import Rhino.Geometry as rg
import Grasshopper as gh
import copy


## add alpaca install directory to system path

ghcompfolder = gh.Folders.DefaultAssemblyFolder
if ghcompfolder not in sys.path:
    sys.path.append(ghcompfolder)

try:
    from Alpaca4d import alpaca4d as alpaca
except:
    msg = "Cannot import Alpaca4d. Is the Alpaca4d folder available in " + ghcompfolder + "?"
    ghenv.Component.AddRuntimeMessage(gh.Kernel.GH_RuntimeMessageLevel.Error, msg)


checkData = True

if not thickness:
    checkData = False
    msg = "Input parameter thickness failed to collect data"
    ghenv.Component.AddRuntimeMessage(gh.Kernel.GH_RuntimeMessageLevel.Warning, msg)

if not nDMaterial:
    checkData = False
    msg = "Input parameter nDMaterial failed to collect data"
    ghenv.Component.AddRuntimeMessage(gh.Kernel.GH_RuntimeMessageLevel.Warning, msg)

if checkData:
    fiberSection = alpaca.PlateFiberSection(secName, thickness, nDMaterial)
# ---------- end python_4 ----------

# ----
# Mesh to Shell
# ShellMITC4, ShellNLDKGT
python_5 = GhPythonScript(CrossSection=python_4.fiberSection)  # -> out, Shell; inputs Mesh: Mesh, Colour: Color
# ---------- python_5: Python ----------
"""
Create a support
-
    Args:
        Mesh:
        CrossSection:
        Colour:
    Returns:
        Shell:
"""


import sys
import Rhino.Geometry as rg
import Grasshopper as gh
import copy
from System.Drawing import Color


## add alpaca install directory to system path

ghcompfolder = gh.Folders.DefaultAssemblyFolder
if ghcompfolder not in sys.path:
    sys.path.append(ghcompfolder)

try:
    from Alpaca4d import alpaca4d as alpaca
except:
    msg = "Cannot import Alpaca4d. Is the Alpaca4d folder available in " + ghcompfolder + "?"
    ghenv.Component.AddRuntimeMessage(gh.Kernel.GH_RuntimeMessageLevel.Error, msg)


checkData = True

if not Mesh:
    checkData = False
    msg = "Input parameter Mesh failed to collect data"
    ghenv.Component.AddRuntimeMessage(gh.Kernel.GH_RuntimeMessageLevel.Warning, msg)

if not CrossSection:
    checkData = False
    msg = "Input parameter CrossSection failed to collect data"
    ghenv.Component.AddRuntimeMessage(gh.Kernel.GH_RuntimeMessageLevel.Warning, msg)

if not Colour:
    Colour = Color.Blue


if checkData:
    
    Mesh.Unweld(0,True)
    explodedMesh = Mesh.ExplodeAtUnweldedEdges()
    if explodedMesh.Length > 0:
        Shell = []
        for mesh in explodedMesh:
            if mesh.Vertices.Count == 4:
                Shell.append(alpaca.ShellMITC4(mesh, copy.deepcopy(CrossSection), Colour))
            elif mesh.Vertices.Count == 3:
                Shell.append(alpaca.ShellNLDKGT(mesh, copy.deepcopy(CrossSection), Colour))
    elif explodedMesh.Length == 0:
        if Mesh.Vertices.Count == 4:
                Shell = alpaca.ShellMITC4(Mesh, copy.deepcopy(CrossSection), Colour)
        elif Mesh.Vertices.Count == 3:
            Shell = alpaca.ShellNLDKGT(Mesh, copy.deepcopy(CrossSection), Colour)
    
    #Vertices = Shell.Mesh.Vertices.ToPoint3dArray()
# ---------- end python_5 ----------

eim = ElasticIsotropicMaterialAlpaca4d()  # -> out, nDMaterial
# ---------- eim: Python ----------
"""
Create a nD Elastic Isotropic Material
-
    Args:
        name:
        E:
        G:
        v:
        rho:
    Returns:
        nDMaterial:
"""

ghenv.Component.Name = "Elastic Isotropic Material (Alpaca4d)"
ghenv.Component.NickName = 'EIM'
ghenv.Component.Message = "Elastic Isotropic Material\n (Alpaca4d)"


import sys
import Rhino.Geometry as rg
import Grasshopper as gh
import copy


## add alpaca install directory to system path

ghcompfolder = gh.Folders.DefaultAssemblyFolder
if ghcompfolder not in sys.path:
    sys.path.append(ghcompfolder)

try:
    from Alpaca4d import alpaca4d as alpaca
except:
    msg = "Cannot import Alpaca4d. Is the Alpaca4d folder available in " + ghcompfolder + "?"
    ghenv.Component.AddRuntimeMessage(gh.Kernel.GH_RuntimeMessageLevel.Error, msg)


checkData = True

if not E:
    checkData = False
    msg = "Input parameter E failed to collect data"
    ghenv.Component.AddRuntimeMessage(gh.Kernel.GH_RuntimeMessageLevel.Warning, msg)

if not G and not v:
    checkData = False
    msg = "Input parameter G or v failed to collect data"
    ghenv.Component.AddRuntimeMessage(gh.Kernel.GH_RuntimeMessageLevel.Warning, msg)

if not rho:
    checkData = False
    msg = "Input parameter rho failed to collect data"
    ghenv.Component.AddRuntimeMessage(gh.Kernel.GH_RuntimeMessageLevel.Warning, msg)

if checkData:
    nDMaterial = alpaca.ElasticIsotropic(name, E, G, rho, v)
# ---------- end eim ----------
addition_2 = Addition(A="0.3", B="2")
mesh_uv = MeshSurface(Surface=move.Geometry, UCount="20", VCount="20", Overhang=True, Equalize=False)
python_6 = GhPythonScript(Mesh=mesh_uv, CrossSection=python_4.fiberSection, Colour=ColourSwatch(SwatchColor=RGB(240, 0, 0)))  # -> out, Shell; inputs Mesh: Mesh, Colour: Color; same code as python_5

number_slider_2 = Slider(72, range=0..441)
number_slider_3 = Slider(270, range=0..441)
number_slider_4 = Slider(319, range=0..441)

demesh = DeconstructMesh(Mesh=mesh_uv)  # -> Vertices, Faces, Colours, Normals
division_3 = Division(A=multiplication, B=addition_2)
division_4 = Division(A="25", B="9.81")
area = Area(Geometry=planesrf)  # -> Area, Centroid

# ----
# uniAxial
panel = Panel("S235")
ghpython_script = GhPythonScript(name=panel, E=multiplication, eta=Slider(9.55, range=5..20), G=division_3, v="0.3", rho=division_4)  # -> out, steel
# ---------- ghpython_script: Python ----------
try:
    from Alpaca4d import alpaca4d as alpaca
except:
    msg = "Cannot import Alpaca4d. Is the Alpaca4d folder available in " + ghcompfolder + "?"
    ghenv.Component.AddRuntimeMessage(gh.Kernel.GH_RuntimeMessageLevel.Error, msg)

steel = alpaca.uniAxialMaterialElastic(name, E, Eneg, eta, G, v, rho)


print(steel.Eneg)



print(steel.write_tcl())
# ---------- end ghpython_script ----------

lng = ListLength(List=demesh.Vertices)
item = ListItem(List=area.Area, Index=0, Wrap=True)
galapagos = Galapagos(fitness=data_3, gene=[number_slider_2, number_slider_4, number_slider_3])
item_2 = ListItem(List=demesh.Vertices, Index=number_slider_2, Wrap=True)
item_3 = ListItem(List=demesh.Vertices, Index=number_slider_4, Wrap=True)
item_4 = ListItem(List=demesh.Vertices, Index=number_slider_3, Wrap=True)
multiplication_2 = Multiplication(A=item, B="12")
number_slider_5 = Slider(0.8, range=0..1)
merge = Merge(Data1=item_2, Data2=item_3, Data3=item_4)
division_5 = Division(A=multiplication_2, B=lng)
division_6 = Division(A=number_slider_5, B="2")
neg = Negative(Value=division_5)
Z_2 = UnitZ(Factor=1)  # -> expr("-x", UnitVector)
circle_cross_section = CircleCrossSectionAlpaca4d(d=number_slider_5, t=division_6, material=ghpython_script.steel)  # -> out, CrossSection
# ---------- circle_cross_section: Python ----------
"""
Create a Circle Cross Section
-
    Args:
        secName:
        Area:
        Izz:
        Iyy:
        J:
        alphaY:
        alphaZ:
        material:
    Returns:
        genericSection:
"""


import sys
import Rhino.Geometry as rg
import Grasshopper as gh
import copy


## add alpaca install directory to system path

ghcompfolder = gh.Folders.DefaultAssemblyFolder
if ghcompfolder not in sys.path:
    sys.path.append(ghcompfolder)

try:
    from Alpaca4d import alpaca4d as alpaca
except:
    msg = "Cannot import Alpaca4d. Is the Alpaca4d folder available in " + ghcompfolder + "?"
    ghenv.Component.AddRuntimeMessage(gh.Kernel.GH_RuntimeMessageLevel.Error, msg)


checkData = True

if not d:
    checkData = False
    msg = "Input parameter d failed to collect data"
    ghenv.Component.AddRuntimeMessage(gh.Kernel.GH_RuntimeMessageLevel.Warning, msg)

if not t:
    checkData = False
    msg = "Input parameter t failed to collect data"
    ghenv.Component.AddRuntimeMessage(gh.Kernel.GH_RuntimeMessageLevel.Warning, msg)

if not material:
    checkData = False
    msg = "Input parameter material failed to collect data"
    ghenv.Component.AddRuntimeMessage(gh.Kernel.GH_RuntimeMessageLevel.Warning, msg)



if checkData:
    circleCS = alpaca.CircleCS(d,t,material)
    CrossSection = alpaca.ElasticSection(secName, circleCS.Area(), circleCS.Izz(), circleCS.Iyy(), circleCS.J(), circleCS.alphaY, circleCS.alphaZ, circleCS.material)
    CrossSection.sectionBrep = circleCS.sectionBrep
    CrossSection.crv = circleCS.crv
# ---------- end circle_cross_section ----------
# PointLoad
rectangular_cross_section = RectangularCrossSectionAlpaca4d(b=Slider(0.3, range=0..1), h=Slider(0.7, range=0..1), material=ghpython_script.steel)  # -> out, CrossSection
# ---------- rectangular_cross_section: Python ----------
"""
Create a Rectangular Cross Section
-
    Args:
        secName:
        Area:
        Izz:
        Iyy:
        J:
        alphaY:
        alphaZ:
        material:
    Returns:
        genericSection:
"""


import sys
import Rhino.Geometry as rg
import Grasshopper as gh
import copy


## add alpaca install directory to system path

ghcompfolder = gh.Folders.DefaultAssemblyFolder
if ghcompfolder not in sys.path:
    sys.path.append(ghcompfolder)

try:
    from Alpaca4d import alpaca4d as alpaca
except:
    msg = "Cannot import Alpaca4d. Is the Alpaca4d folder available in " + ghcompfolder + "?"
    ghenv.Component.AddRuntimeMessage(gh.Kernel.GH_RuntimeMessageLevel.Error, msg)


checkData = True

if not b:
    checkData = False
    msg = "Input parameter b failed to collect data"
    ghenv.Component.AddRuntimeMessage(gh.Kernel.GH_RuntimeMessageLevel.Warning, msg)

if not h:
    checkData = False
    msg = "Input parameter h failed to collect data"
    ghenv.Component.AddRuntimeMessage(gh.Kernel.GH_RuntimeMessageLevel.Warning, msg)

if not material:
    checkData = False
    msg = "Input parameter material failed to collect data"
    ghenv.Component.AddRuntimeMessage(gh.Kernel.GH_RuntimeMessageLevel.Warning, msg)



if checkData:
    rectCS = alpaca.RectangularCS(b,h,material)
    CrossSection = alpaca.ElasticSection(secName, rectCS.Area(), rectCS.Izz(), rectCS.Iyy(), rectCS.J(), rectCS.alphaY, rectCS.alphaZ, rectCS.material)
    CrossSection.sectionBrep = rectCS.sectionBrep
    CrossSection.crv = rectCS.crv
# ---------- end rectangular_cross_section ----------
vec = VectorXYZ(XComponent=0, YComponent=0, ZComponent=neg)  # -> Vector, Length
line = LineSDL(Start=merge, Direction=Z_2, Length=number_slider)
# tcl
pl = PointLoadAlpaca4d(Pos=demesh.Vertices, Force=vec.Vector, TimeSeries=python.timeSeries)  # -> out, PointLoad; inputs Pos: Point3d, Force: Vector3d, Moment: Vector3d
# ---------- pl: Python ----------
"""
Create a Point Load
-
    Args:
        Pos:
        Force:
        Moment:
        TimeSeries:
    Returns:
        PointLoad:
"""

ghenv.Component.Name = "Point Load (Alpaca4d)"
ghenv.Component.NickName = 'PL'
ghenv.Component.Message = "Point Load (Alpaca4d)"



import sys
import Rhino.Geometry as rg
import Grasshopper as gh
import copy


## add alpaca install directory to system path

ghcompfolder = gh.Folders.DefaultAssemblyFolder
if ghcompfolder not in sys.path:
    sys.path.append(ghcompfolder)

try:
    from Alpaca4d import alpaca4d as alpaca
except:
    msg = "Cannot import Alpaca4d. Is the Alpaca4d folder available in " + ghcompfolder + "?"
    ghenv.Component.AddRuntimeMessage(gh.Kernel.GH_RuntimeMessageLevel.Error, msg)


checkData = True

if not Pos:
    checkData = False
    msg = "Input parameter Pos failed to collect data"
    ghenv.Component.AddRuntimeMessage(gh.Kernel.GH_RuntimeMessageLevel.Warning, msg)

if not Force:
    Force = rg.Vector3d(0,0,0)

if not Moment:
    Moment = rg.Vector3d(0,0,0)

if not TimeSeries:
    checkData = False
    msg = "Input parameter TimeSeries failed to collect data"
    ghenv.Component.AddRuntimeMessage(gh.Kernel.GH_RuntimeMessageLevel.Warning, msg)


if checkData:
    PointLoad = alpaca.PointLoad(Pos, Force, Moment, TimeSeries)
# ---------- end pl ----------
end = EndPoints(Curve=line)  # -> Start, End

# ----
# Support
toggle = BooleanToggle(True)
toggle_2 = BooleanToggle(True)
support = SupportAlpaca4d(Pos=flatten(end.End), Tx=toggle, Ty=toggle, Tz=toggle, Rx=toggle, Ry=toggle_2, Rz=toggle_2)  # -> Support; inputs Pos: Point3d, Tx: Boolean, Ty: Boolean, Tz: Boolean, Rx: Boolean, Ry: Boolean, Rz: Boolean
# ---------- support: Python ----------
"""
Create a support
-
    Args:
        Pos:
        Tx:
        Ty:
        Tz:
        Rx:
        Ry:
    Returns:
        Support:
"""

ghenv.Component.Name = "Support (Alpaca4d)"
ghenv.Component.NickName = 'Support'
ghenv.Component.Message = "Support (Alpaca4d)"


import sys
import Rhino.Geometry as rg
import Grasshopper as gh


## add alpaca install directory to system path

ghcompfolder = gh.Folders.DefaultAssemblyFolder
if ghcompfolder not in sys.path:
    sys.path.append(ghcompfolder)

try:
    from Alpaca4d import alpaca4d as alpaca
except:
    msg = "Cannot import Alpaca4d. Is the Alpaca4d folder available in " + ghcompfolder + "?"
    ghenv.Component.AddRuntimeMessage(gh.Kernel.GH_RuntimeMessageLevel.Error, msg)

checkData = True


if not Pos:
    checkData = False
    msg = "Input parameter Pos failed to collect data"
    ghenv.Component.AddRuntimeMessage(gh.Kernel.GH_RuntimeMessageLevel.Warning, msg)

if checkData:
    Support = alpaca.Support(Pos, Tx, Ty, Tz, Rx, Ry, Rz)
# ---------- end support ----------

ssp = SSPBrickAlpaca4d(nDMaterial=python_3.nDMaterial)  # -> out, Element; inputs Brick: Mesh, Colour: Color
# ---------- ssp: Python ----------
"""
Create a Stabilized Single Point Brick (SSPbrick)
-
    Args:
        Brick:
        nDMaterial:
        Colour:
    Returns:
        element:
"""

ghenv.Component.Name = "SSP brick (Alpaca4d)"
ghenv.Component.NickName = 'SSP'
ghenv.Component.Message = "SSP brick (Alpaca4d)"


import sys
import Rhino.Geometry as rg
import Grasshopper as gh
import copy


## add alpaca install directory to system path

ghcompfolder = gh.Folders.DefaultAssemblyFolder
if ghcompfolder not in sys.path:
    sys.path.append(ghcompfolder)

try:
    from Alpaca4d import alpaca4d as alpaca
except:
    msg = "Cannot import Alpaca4d. Is the Alpaca4d folder available in " + ghcompfolder + "?"
    ghenv.Component.AddRuntimeMessage(gh.Kernel.GH_RuntimeMessageLevel.Error, msg)


checkData = True

if not Brick:
    checkData = False
    msg = "Input parameter Brick failed to collect data"
    ghenv.Component.AddRuntimeMessage(gh.Kernel.GH_RuntimeMessageLevel.Warning, msg)

if not nDMaterial:
    checkData = False
    msg = "Input parameter nDMaterial failed to collect data"
    ghenv.Component.AddRuntimeMessage(gh.Kernel.GH_RuntimeMessageLevel.Warning, msg)


if checkData:
    Element = alpaca.SSPbrick(Brick,copy.deepcopy(nDMaterial), Colour)
# ---------- end ssp ----------
stdb = StdBrickAlpaca4d(Colour=ColourSwatch(SwatchColor=RGB(255, 255, 255)))  # -> out, Element; inputs Brick: Mesh, Colour: Color
# ---------- stdb: Python ----------
"""
Create a Standard Brick (stdBrick)
-
    Args:
        Brick:
        nDMaterial:
        Colour:
    Returns:
        Element:
"""

ghenv.Component.Name = "std Brick (Alpaca4d)"
ghenv.Component.NickName = 'STDB'
ghenv.Component.Message = "std Brick (Alpaca4d)"


import sys
import Rhino.Geometry as rg
import Grasshopper as gh
import copy
from System.Drawing import Color


## add alpaca install directory to system path

ghcompfolder = gh.Folders.DefaultAssemblyFolder
if ghcompfolder not in sys.path:
    sys.path.append(ghcompfolder)

try:
    from Alpaca4d import alpaca4d as alpaca
except:
    msg = "Cannot import Alpaca4d. Is the Alpaca4d folder available in " + ghcompfolder + "?"
    ghenv.Component.AddRuntimeMessage(gh.Kernel.GH_RuntimeMessageLevel.Error, msg)


checkData = True

if not Brick:
    checkData = False
    msg = "Input parameter Brick failed to collect data"
    ghenv.Component.AddRuntimeMessage(gh.Kernel.GH_RuntimeMessageLevel.Warning, msg)

if not nDMaterial:
    checkData = False
    msg = "Input parameter nDMaterial failed to collect data"
    ghenv.Component.AddRuntimeMessage(gh.Kernel.GH_RuntimeMessageLevel.Warning, msg)

if not Colour:
    Colour = Color.DarkOrange


if checkData:
    #Brick = alpacaUtil.cleanHexahedron(Brick)
    Element = alpaca.stdBrick(Brick,copy.deepcopy(nDMaterial), Colour)
# ---------- end stdb ----------
lts = LinearTimeSeriesAlpaca4d()  # -> TimeSeries, Graph
# ---------- lts: Python ----------
"""
Create a Linear Time Series
-
    Args:
        tStart:
        tEnd:
        period:
        factor:
        shift:
    Returns:
        TimeSeries:
        Graph:
"""

ghenv.Component.Name = "Linear Time Series (Alpaca4d)"
ghenv.Component.NickName = 'LTS'
ghenv.Component.Message = "Linear Time Series (Alpaca4d)"

import sys
import Rhino.Geometry as rg
import Grasshopper as gh
import copy
import math


## add alpaca install directory to system path

ghcompfolder = gh.Folders.DefaultAssemblyFolder
if ghcompfolder not in sys.path:
    sys.path.append(ghcompfolder)

try:
    from Alpaca4d import alpaca4d as alpaca
except:
    msg = "Cannot import Alpaca4d. Is the Alpaca4d folder available in " + ghcompfolder + "?"
    ghenv.Component.AddRuntimeMessage(gh.Kernel.GH_RuntimeMessageLevel.Error, msg)


def linearSeries(x):
    return x



checkData = True

if not linearFactor:
    linearFactor = 1




if checkData:
    TimeSeries = alpaca.TimeSeriesLinear(linearFactor)
    
    Graph = []
    
    for x in range(10):
        Graph.append(linearSeries(x * linearFactor))
# ---------- end lts ----------
ghpython_script_2 = GhPythonScript(Line=line, CrossSection=circle_cross_section.CrossSection, Colour=ColourSwatch(SwatchColor=RGB(153, 11, 11)))  # -> out, element; inputs Line: Curve, Colour: Color, Orient: Boolean
# ---------- ghpython_script_2: Python ----------
try:
    from Alpaca4d import alpaca4d as alpaca
except:
    msg = "Cannot import Alpaca4d. Is the Alpaca4d folder available in " + ghcompfolder + "?"
    ghenv.Component.AddRuntimeMessage(gh.Kernel.GH_RuntimeMessageLevel.Error, msg)
import copy


newCrossSection = copy.deepcopy(CrossSection)

if not Colour:
    Colour = Color.Red

if Orient is None:
    Orient = 0.0

element = alpaca.ForceBeamColumn(Line, newCrossSection, Colour, Orient)
# ---------- end ghpython_script_2 ----------
ghpython_script_3 = GhPythonScript(CrossSection=rectangular_cross_section.CrossSection, Colour=ColourSwatch(SwatchColor=RGB(255, 223, 64)))  # -> out, flatten(element); inputs Line: Curve, Colour: Color, Orient: Boolean; same code as ghpython_script_2
gl = GravityLoadAlpaca4d(GravityFactor=1, TimeSeries=lts.TimeSeries)  # -> out, Load
# ---------- gl: Python ----------
"""
Create Gravity Load
-
    Args:
        Pos:
        Force:
        Moment:
        TimeSeries:
    Returns:
        PointLoad:
"""

ghenv.Component.Name = "Gravity Load (Alpaca4d)"
ghenv.Component.NickName = 'GL'
ghenv.Component.Message = "Gravity Load (Alpaca4d)"



import sys
import Rhino.Geometry as rg
import Grasshopper as gh
import copy


## add alpaca install directory to system path

ghcompfolder = gh.Folders.DefaultAssemblyFolder
if ghcompfolder not in sys.path:
    sys.path.append(ghcompfolder)

try:
    from Alpaca4d import alpaca4d as alpaca
except:
    msg = "Cannot import Alpaca4d. Is the Alpaca4d folder available in " + ghcompfolder + "?"
    ghenv.Component.AddRuntimeMessage(gh.Kernel.GH_RuntimeMessageLevel.Error, msg)

if not TimeSeries:
    TimeSeries = alpaca.TimeSeriesConstant(1)

Load = alpaca.GravityLoad(GravityFactor, TimeSeries)
# ---------- end gl ----------
am = AssembleModelAlpaca4d(Element=flatten([python_6.Shell, ghpython_script_2.element]), Support=flatten(support), Load=flatten(pl.PointLoad))  # -> out, AlpacaModel, Mass; inputs Element: list, Support: list, Load: list, Constraint: list
# ---------- am: Python ----------
"""
Create a FEA Model
-
    Args:
        Element:
        Support:
        Load:
        Constraint:
    Returns:
        AlpacaModel:
"""

ghenv.Component.Name = "Assemble Model (Alpaca4d)"
ghenv.Component.NickName = 'AM'
ghenv.Component.Message = "Assemble Model (Alpaca4d)"




import os
from Alpaca4d import alpaca4d as alpaca
import ghpythonlib.treehelpers as th
import Rhino.Geometry as rg
import Rhino.Collections as rc
import rhinoscriptsyntax as rs
from collections import defaultdict, OrderedDict
import copy
import time



FolderPath = rs.DocumentPath()
os.chdir(FolderPath)

# create the object model
AlpacaModel = alpaca.Model()


start = time.clock()
#subdivide element per type

for element in Element:
    if element.type == "Beam":
        AlpacaModel.beams.append(element)
    elif element.type == "Shell":
        AlpacaModel.shells.append(element)
    elif element.type == "Brick":
        AlpacaModel.bricks.append(element)

end = time.clock() - start
print("time to subdivide element {}".format(end))
start = time.clock()

# create a list of unique point
# need to add the rigid constraint

AlpacaModel.getuniquePoints(AlpacaModel.beams, AlpacaModel.shells, AlpacaModel.bricks, AlpacaModel.constraints)


end = time.clock() - start
print("time to get uniquepoints {}".format(end))
start = time.clock()


#############
# create node and assign to object
#############

if AlpacaModel.uniquePointsThreeNDF:
    AlpacaModel.py.append(alpaca.Model.write3ndf_tcl())
    for point in AlpacaModel.uniquePointsThreeNDF:
        node = alpaca.Node(point)
        node.ndf = 3
        node.setNodeTag(AlpacaModel)
        AlpacaModel.nodes.append( node )
    
        AlpacaModel.py.append(node.write_tcl())


if AlpacaModel.uniquePointsSixNDF:
    AlpacaModel.py.append(alpaca.Model.write6ndf_tcl())
    for point in AlpacaModel.uniquePointsSixNDF:
        node = alpaca.Node(point)
        node.ndf = 6
        node.setNodeTag(AlpacaModel)
        AlpacaModel.nodes.append( node )
     
        AlpacaModel.py.append(node.write_tcl())



end = time.clock() - start
print("time to create node and assign tag {}".format(end))
start = time.clock()


#################
# create supports
#################

for supportNode in Support:
    
    # if the list is empty, skip this operation
    if AlpacaModel.uniquePointsThreeNDF:
        closestPointInThreeNDF = rc.Point3dList.ClosestPointInList(AlpacaModel.uniquePointsThreeNDF, supportNode.Pos)
        if supportNode.Pos.DistanceTo(closestPointInThreeNDF) < 0.001:
            #print("I am in 3ndf")
            supportNode.ndf = 3
            AlpacaModel.threeNDFModel.append(supportNode)
            supportNode.setNodeTag(AlpacaModel)
    
    if AlpacaModel.uniquePointsSixNDF:
        closestPointInSixNDF = rc.Point3dList.ClosestPointInList(AlpacaModel.uniquePointsSixNDF, supportNode.Pos)
        if supportNode.Pos.DistanceTo(closestPointInSixNDF) < 0.001:
            supportNode.ndf = 6
            AlpacaModel.sixNDFModel.append(supportNode)
            supportNode.setNodeTag(AlpacaModel)
    
    
    AlpacaModel.supports.append(supportNode)
    AlpacaModel.py.append(supportNode.write_tcl())


end = time.clock() - start
print("time to create support and assign tag {}".format(end))
start = time.clock()


####################
# create constraints
####################


for constraint in Constraint:
    constraint.setNodeTag(AlpacaModel)
    AlpacaModel.constraints.append(constraint)

####################
# create equalDOF when the model has 3df and 6df together
####################


end = time.clock() - start
print("time to create constraint and assign tag {}".format(end))
start = time.clock()


Id = []
IdB = []

def SearchCallback(sender, e):
    Id.Add(e.Id)
    IdB.Add(e.IdB)



lenThreeNDF = len(AlpacaModel.uniquePointsThreeNDF)
lenSixNDF = len(AlpacaModel.uniquePointsSixNDF)


if not(lenThreeNDF == 0 or lenSixNDF == 0):
    print("brick and beam together")
    rg.RTree.SearchOverlaps(AlpacaModel.RTreeCloudPointThreeNDF, AlpacaModel.RTreeCloudPointSixNDF, 0.001, SearchCallback)
    
    for i,j in zip(Id, IdB):
        print(i,j)
        node_i = AlpacaModel.uniquePointsThreeNDF[i]
        node_j = AlpacaModel.uniquePointsSixNDF[j]
        
        #index_i = AlpacaModel.cloudPoint.ClosestPoint(node_i) + 1
        #index_j = AlpacaModel.cloudPoint.ClosestPoint(node_j) + 1
        
        equalConstraint = alpaca.EqualDOF(node_i, node_j, True, True, True, False, False, False)
        equalConstraint.masterNodeTag = AlpacaModel.cloudPointThreeNDF.ClosestPoint(node_i) + 1
        equalConstraint.slaveNodesTag = AlpacaModel.cloudPointSixNDF.ClosestPoint(node_j) + 1 + len(AlpacaModel.uniquePointsThreeNDF)
        AlpacaModel.py.append(equalConstraint.write_tcl())



end = time.clock() - start
print("time to find common points between 3ndf and 6ndf {}".format(end))
start = time.clock()


# write py file


# assign tag and node Index to element and shell
for index, element in enumerate(Element,1):
    element.setTopologyRTree(AlpacaModel)
    element.eleTag = index
    element.setTags()



end = time.clock() - start
print("time to assign tags for the elements {}".format(end))
start = time.clock()



Mass = 0
IsGravity = False

for item in Load:
    if item.type == "Gravity Load":
        IsGravity = True
        GravityLoad = item
    if item.type == "PointLoad":
        AlpacaModel.loads.append(item)


for item in Element:
    if item.type == "Beam":
        length = item.Crv.GetLength()
        Mass += (item.massDens * length)
        if IsGravity:
            gravityPointLoad = alpaca.PointLoad(item.Crv.PointAtStart, rg.Vector3d(0,0, -(item.massDens * length / 2)) * GravityLoad.GravityFactor, rg.Vector3d(0,0,0), GravityLoad.TimeSeries)
            #print( -(item.massDens * length / 2))
            AlpacaModel.loads.append(gravityPointLoad)
    if item.type == "Shell":
        meshArea = rg.AreaMassProperties.Compute(item.Mesh).Area
        areaDensity = item.CrossSection.height * item.CrossSection.material.rho
        Mass += areaDensity * meshArea
        if IsGravity:
            for vertex in item.Mesh.Vertices.ToPoint3dArray():
                gravityPointLoad = alpaca.PointLoad(vertex, rg.Vector3d(0,0, -(areaDensity * meshArea/ len(item.Mesh.Vertices))) * GravityLoad.GravityFactor, rg.Vector3d(0,0,0), GravityLoad.TimeSeries)
                AlpacaModel.loads.append(gravityPointLoad)
    if item.type == "Brick":
        #print(type(item.Mesh))
        meshVolume = rg.VolumeMassProperties.Compute(item.Mesh).Volume
        density = item.material.rho 
        Mass += density * meshVolume
        if IsGravity:
            for vertex in item.Mesh.Vertices.ToPoint3dArray():
                gravityPointLoad = alpaca.PointLoad(vertex, rg.Vector3d(0,0, -(density * meshVolume / len(item.Mesh.Vertices))) * GravityLoad.GravityFactor, rg.Vector3d(0,0,0), GravityLoad.TimeSeries)
                #print(len(item.Mesh.Vertices))
                #print(density)
                # volume can be zero if mesh faces are not properly rotated
                #print(meshVolume)
                #print(-(density * meshVolume / len(item.Mesh.Vertices)))
                AlpacaModel.loads.append(gravityPointLoad)

#print(AlpacaModel.loads)
## load

for item in AlpacaModel.loads:
    item.setNodeTag(AlpacaModel)

#print(AlpacaModel.loads)

for item in AlpacaModel.beams:
    AlpacaModel.py.append(item.write_tcl())

for item in AlpacaModel.shells:
    AlpacaModel.py.append(item.write_tcl())

for item in AlpacaModel.bricks:
    AlpacaModel.py.append(item.write_tcl())


for item in Constraint:
    AlpacaModel.py.append(item.write_tcl())


timeSeriesDict = alpaca.TimeSeries.getTimeSeries(AlpacaModel.loads)[1]
AlpacaModel.py.append(alpaca.PointLoad.write_tcl(timeSeriesDict,AlpacaModel))
# ---------- end am ----------
panel_2 = Panel("Plain")
panel_3 = Panel("BandGen")
as = AnalysisSettingsAlpaca4d(Algorithm="KrylovNewton", AnalysisSteps="5")  # -> out, Analysis
# ---------- as: Python ----------
"""
Create Analysis settings
-
    Args:
        Constraint: 'Plain', 'Transformation'. Default is 'Transformation'.
        Numberer: 'RCM', 'AMD', 'Plain'. Default is 'RCM'.
        System: 'BandGen', 'BandSPD', 'ProfileSPD', 'SuperLU', 'UmfPack', 'FullGeneral', 'SparseSYM'. Default is 'BandSPD'.
        Test: Feature not implemented. Please contact alpaca4d@gmail.com 
        Algorithm: 'Linear', 'Newton', 'NewtonLineSearch', 'ModifiedNewton', 'KrylovNewton', 'SecantNewton', 'BFGS', 'Broyden'. Default is 'Linear'.
        Integrator: Default is LoadControl.
        AnalysisType: 'Static', 'Transient'. Default is 'Static'.
        AnalyesSteps:
    Returns:
        Analysis:
"""

import sys
import os


import clr
import clrtype
import Rhino.Geometry as rg
import rhinoscriptsyntax as rs
import Grasshopper as gh
import copy
import ghpythonlib.treehelpers as th


ghenv.Component.Name = "Analysis settings (Alpaca4d)"
ghenv.Component.NickName = 'AS'
ghenv.Component.Message = "Analysis settings \n(Alpaca4d)"



from Alpaca4d import alpaca4d as alpaca

checkData = True


# default Value
Constraint = 'Transformation' if Constraint is None else Constraint
ConstraintList = ['Plain', 'Transformation']

for item in ConstraintList:
    if Constraint.lower() == item.lower():
        print(item)
        Constraint = item


# default Value
Numberer = 'RCM' if Numberer is None else Numberer
NumbererList = ['RCM', 'AMD', 'Plain', 'ParallelPlain', 'ParallelRCM']

for i,item in enumerate(NumbererList):
    if Numberer.lower() == item.lower():
        Numberer = item



# default Value
System = 'BandSPD' if System is None else System
SystemList = ['BandGen', 'BandSPD', 'ProfileSPD', 'SuperLU', 'UmfPack', 'FullGeneral', 'SparseSYM']

for i,item in enumerate(SystemList):
    if System.lower() == item.lower():
        System = item


# default Test
Test = 'NormDispIncr 1.0e-6 12 5' if Test is None else Test




# default Value
Algorithm = 'Linear' if Algorithm is None else Algorithm
AlgorithmList = ['Linear', 'Newton', 'NewtonLineSearch', 'ModifiedNewton', 'KrylovNewton', 'SecantNewton', 'BFGS', 'Broyden']

for i,item in enumerate(AlgorithmList):
    if Algorithm.lower() == item.lower():
        Algorithm = item


# default Value
AnalysisType = 'Static' if AnalysisType is None else AnalysisType
AnalysisTypeList = ['Static', 'Transient']

for item in AnalysisTypeList:
    if AnalysisType.lower() == item.lower():
        AnalysisType = item


## Define Integrator
if AnalysisType == "Static":
    Integrator = "LoadControl 1.0" if Integrator is None else Integrator
elif AnalysisType == "Transien":
    Integrator = "Newmark 0.5 0.25" if Integrator is None else Integrator



if not AnalysisSteps:
    checkData = False
    msg = "Input parameter AnalysisSteps failed to collect data"
    ghenv.Component.AddRuntimeMessage(gh.Kernel.GH_RuntimeMessageLevel.Warning, msg)


if checkData:
    Analysis = alpaca.Analysis(Constraint, Numberer,System,Test,Algorithm,Integrator,AnalysisType, AnalysisSteps)
    print(Analysis.write_tcl())
# ---------- end as ----------
ra = RunAnalysisAlpaca4d(AlpacaModel=am.AlpacaModel, Settings=as.Analysis)  # -> log, AlpacaSolvedModel
# ---------- ra: Python ----------
"""
Run an OpenSees Analysis
-
    Args:
        AlpacaModel:
        Settings:
    Returns:
        AlpacaSolvedModel:
"""



import Rhino.RhinoDoc
import Grasshopper as gh
import copy
import rhinoscriptsyntax as rs
import os
import time
import sys



ghenv.Component.Name = "Run Analysis (Alpaca4d)"
ghenv.Component.NickName = 'RA'
ghenv.Component.Message = "Run Analysis (Alpaca4d)"

ghcompfolder = gh.Folders.DefaultAssemblyFolder
if ghcompfolder not in sys.path:
    sys.path.append(ghcompfolder)

try:
    from Alpaca4d import alpaca4d as alpaca
except:
    msg = "Cannot import Alpaca4d. Is the Alpaca4d folder available in " + ghcompfolder + "?"
    ghenv.Component.AddRuntimeMessage(gh.Kernel.GH_RuntimeMessageLevel.Error, msg)


checkData = True



if not AlpacaModel:
    checkData = False
    msg = "Input parameter AlpacaModel failed to collect data"
    ghenv.Component.AddRuntimeMessage(gh.Kernel.GH_RuntimeMessageLevel.Warning, msg)


if not Settings:
    checkData = False
    msg = "Input parameter Settings failed to collect data"
    ghenv.Component.AddRuntimeMessage(gh.Kernel.GH_RuntimeMessageLevel.Warning, msg)


if checkData:
    FolderPath = rs.DocumentPath()
    os.chdir(FolderPath)
    
    outputFileName = 'openSeesModel'
    recorderFileName = 'recorder.mpco'
    
    for dirpath, dirnames, filenames in os.walk(FolderPath):
        for filename in filenames:
            if filename == outputFileName:
                file = os.path.join(dirpath,outputFileName)
                os.remove(file)
            elif filename == recorderFileName:
                file = os.path.join(dirpath,recorderFileName)
                os.remove(file)
    
    
    # create a copy
    
    AnalysisModel = copy.copy(AlpacaModel)
    AnalysisModel.py = list(AnalysisModel.py)
    
    # generate Recorder and assign name
    AnalysisModel.recorderName = "recorder" + ".mpco"
    
    AnalysisModel.py.append(alpaca.TCLRecorder.mpco(AnalysisModel.recorderName, True,True,True,True,False,False,True,True,True,True))
    
    
    AnalysisModel.analysis = Settings
    AnalysisModel.py.append(Settings.write_tcl())
    AnalysisModel.py.append("wipe")
    
    
    #textFile = AnalysisModel.py
    
    time_start = time.clock()
    
    AnalysisModel.writeFile(outputFileName)
    
    time_elapsed = (time.clock() - time_start)
    print("Writing Time {}".format(time_elapsed))
    
    
    
    time_start = time.clock()
    
    executable = os.path.join(ghcompfolder,'Alpaca4d\OpenSees-Solvers\opensees.bat')
    a, log = AnalysisModel.runOpensees(executable)
    
    
    time_elapsed = (time.clock() - time_start)
    print("Analyses Time {}".format(time_elapsed))
    
    AlpacaSolvedModel = copy.copy(AnalysisModel)
    AlpacaSolvedModel.isAnalysed = True
# ---------- end ra ----------
number_slider_6 = Slider(0, range=0..10)
gradientlibrary = GradientLibrary(gradIndex=Slider(4, range=1..12))  # -> reverse(colors); inputs gradIndex: Int32
#   port colors: A series of colors to be plugged into the "Ladybug_Legend Parameters" component.
# ---------- gradientlibrary: Python ----------
"""
Preset of gradient colors perfect for Data Visualisation
    Inputs:
        gradIndex: An index refering to one of the following possible gradients:
            0 - Orignal Ladybug
            1 - Nuanced Ladybug
            2 - Multi-colored Ladybug
            3 - Ecotect
            4 - Thermal Comfort Percentage
            5 - Thermal Comfort Colors
            6 - Shade Benefit/Harm
            7 - Shade Harm
            8 - Shade Benefit
            9 - CFD Colors 1
            10 - Radiation Benefit
            11 - Gsa10 Colour
            12 - Gsa9 Colour
    Returns:
        customColors: A series of colors.
"""

ghenv.Component.Name = "Gradient Library"
ghenv.Component.NickName = 'GradientLibrary'
#ghenv.Component.Message = 'GradientLibrary\nWIP'

import scriptcontext as sc
import Grasshopper.Kernel as gh
import System

gradientLibrary = {
        0: [System.Drawing.Color.FromArgb(75, 107, 169), System.Drawing.Color.FromArgb(115, 147, 202), System.Drawing.Color.FromArgb(170, 200, 247), System.Drawing.Color.FromArgb(193, 213, 208), System.Drawing.Color.FromArgb(245, 239, 103), System.Drawing.Color.FromArgb(252, 230, 74), System.Drawing.Color.FromArgb(239, 156, 21), System.Drawing.Color.FromArgb(234, 123, 0), System.Drawing.Color.FromArgb(234, 74, 0), System.Drawing.Color.FromArgb(234, 38, 0)],
        1: [System.Drawing.Color.FromArgb(49,54,149), System.Drawing.Color.FromArgb(69,117,180), System.Drawing.Color.FromArgb(116,173,209), System.Drawing.Color.FromArgb(171,217,233), System.Drawing.Color.FromArgb(224,243,248), System.Drawing.Color.FromArgb(255,255,191), System.Drawing.Color.FromArgb(254,224,144), System.Drawing.Color.FromArgb(253,174,97), System.Drawing.Color.FromArgb(244,109,67), System.Drawing.Color.FromArgb(215,48,39), System.Drawing.Color.FromArgb(165,0,38)],
        2: [System.Drawing.Color.FromArgb(4,25,145), System.Drawing.Color.FromArgb(7,48,224), System.Drawing.Color.FromArgb(7,88,255), System.Drawing.Color.FromArgb(1,232,255), System.Drawing.Color.FromArgb(97,246,156), System.Drawing.Color.FromArgb(166,249,86), System.Drawing.Color.FromArgb(254,244,1), System.Drawing.Color.FromArgb(255,121,0), System.Drawing.Color.FromArgb(239,39,0), System.Drawing.Color.FromArgb(138,17,0)],
        3: [System.Drawing.Color.FromArgb(0,0,255), System.Drawing.Color.FromArgb(53,0,202), System.Drawing.Color.FromArgb(107,0,148), System.Drawing.Color.FromArgb(160,0,95), System.Drawing.Color.FromArgb(214,0,41), System.Drawing.Color.FromArgb(255,12,0), System.Drawing.Color.FromArgb(255,66,0), System.Drawing.Color.FromArgb(255,119,0), System.Drawing.Color.FromArgb(255,173,0), System.Drawing.Color.FromArgb(255,226,0), System.Drawing.Color.FromArgb(255,255,0)],
        4: [System.Drawing.Color.FromArgb(0,0,0), System.Drawing.Color.FromArgb(110,0,153), System.Drawing.Color.FromArgb(255,0,0), System.Drawing.Color.FromArgb(255,255,102), System.Drawing.Color.FromArgb(255,255,255)],
        5: [System.Drawing.Color.FromArgb(0,136,255), System.Drawing.Color.FromArgb(200,225,255), System.Drawing.Color.FromArgb(255,255,255), System.Drawing.Color.FromArgb(255,230,230), System.Drawing.Color.FromArgb(255,0,0)],
        6: [System.Drawing.Color.FromArgb(5,48,97), System.Drawing.Color.FromArgb(33,102,172), System.Drawing.Color.FromArgb(67,147,195), System.Drawing.Color.FromArgb(146,197,222), System.Drawing.Color.FromArgb(209,229,240), System.Drawing.Color.FromArgb(255,255,255), System.Drawing.Color.FromArgb(253,219,199), System.Drawing.Color.FromArgb(244,165,130), System.Drawing.Color.FromArgb(214,96,77), System.Drawing.Color.FromArgb(178,24,43), System.Drawing.Color.FromArgb(103,0,31)],
        7: [System.Drawing.Color.FromArgb(255,255,255), System.Drawing.Color.FromArgb(253,219,199), System.Drawing.Color.FromArgb(244,165,130), System.Drawing.Color.FromArgb(214,96,77), System.Drawing.Color.FromArgb(178,24,43), System.Drawing.Color.FromArgb(103,0,31)],
        8: [System.Drawing.Color.FromArgb(255,255,255), System.Drawing.Color.FromArgb(209,229,240), System.Drawing.Color.FromArgb(146,197,222), System.Drawing.Color.FromArgb(67,147,195), System.Drawing.Color.FromArgb(33,102,172), System.Drawing.Color.FromArgb(5,48,97)],
        9: [System.Drawing.Color.FromArgb(0,16,120), System.Drawing.Color.FromArgb(38,70,160), System.Drawing.Color.FromArgb(5,180,222), System.Drawing.Color.FromArgb(16,180,109), System.Drawing.Color.FromArgb(59,183,35), System.Drawing.Color.FromArgb(143,209,19), System.Drawing.Color.FromArgb(228,215,29), System.Drawing.Color.FromArgb(246,147,17), System.Drawing.Color.FromArgb(243,74,0), System.Drawing.Color.FromArgb(255,0,0)],
        10: [System.Drawing.Color.FromArgb(0,191,48), System.Drawing.Color.FromArgb(255,238,184), System.Drawing.Color.FromArgb(255,0,0)],
        11: [System.Drawing.Color.FromArgb(204,0,71), System.Drawing.Color.FromArgb(255,182,71), System.Drawing.Color.FromArgb(206,255,115), System.Drawing.Color.FromArgb(26,180, 214),System.Drawing.Color.FromArgb(0,0,207)],
        12: [System.Drawing.Color.FromArgb(255, 51, 51), System.Drawing.Color.FromArgb(255, 170, 51), System.Drawing.Color.FromArgb(255, 255, 51), System.Drawing.Color.FromArgb(170, 255, 125), System.Drawing.Color.FromArgb(51, 255, 231), System.Drawing.Color.FromArgb(51, 170, 255), System.Drawing.Color.FromArgb(51,51, 255)]}
colors = gradientLibrary[gradIndex]
# ---------- end gradientlibrary ----------
number_slider_7 = Slider(1, range=1..12)  # disabled
number_slider_8 = Slider(0.01, range=0..0.01)
toggle_3 = BooleanToggle(True)
num = Number("2e-1")
number_slider_9 = Slider(6, range=0..10)  # disabled

panel_4 = Panel("0.001")  # disabled
number_slider_10 = Slider(0.168, range=0..2)  # disabled
python_7 = GhPythonScript(PointLoad=pl.PointLoad, scale=panel_4)  # -> out, Force, Moment; inputs PointLoad: list; disabled
# ---------- python_7: Python ----------
__author__ = "domy7"
__version__ = "2021.03.21"

import rhinoscriptsyntax as rs
import Rhino.Geometry as rg

def DrawVector( PointLoadClass, c1, viewType, color ):
    if c1 is None:
        c1 = 0.0001
    c = 0.25
    c2 = 0.1
    
    vectorDraw = []
    for iPLoad in PointLoadClass:
        if viewType is not False:
            forceType = iPLoad.Moment
        else:
            forceType = iPLoad.Force
            
        l = forceType.Length*c1
        l1 = forceType.Length*c1*c
        l2 = forceType.Length*c1*c2
        
        planeLoad =rg.Plane( iPLoad.Pos, -forceType )
        point0 = rg.Point3d.Add( iPLoad.Pos, planeLoad.ZAxis*l1)
        point1 =rg.Point3d.Add(point0, planeLoad.XAxis*l2 + planeLoad.YAxis*l2)
        point2 =rg.Point3d.Add(point0, planeLoad.XAxis*l2 - planeLoad.YAxis*l2)
        point3 =rg.Point3d.Add(point0, -planeLoad.XAxis*l2 - planeLoad.YAxis*l2)
        point4 = rg.Point3d.Add( point0, -planeLoad.XAxis*l2 + planeLoad.YAxis*l2)
        #Mesh Puntatore 
        Arrow = rg.Mesh()
        Arrow.Vertices.Add( iPLoad.Pos ) #0
        Arrow.Vertices.Add( point1 ) #1
        Arrow.Vertices.Add( point2 ) #2
        Arrow.Vertices.Add( point3 ) #3
        Arrow.Vertices.Add( point4 ) #4
        Arrow.Faces.AddFace( 0, 1, 2 ) 
        Arrow.Faces.AddFace( 0, 2, 3 )
        Arrow.Faces.AddFace( 0, 3, 4 )
        Arrow.Faces.AddFace( 0, 4, 1 )
        Arrow.Faces.AddFace( 1, 2, 3, 4)
        
        #Mesh Coda 
        point0 = rg.Point3d.Add( iPLoad.Pos, planeLoad.ZAxis*l)
        point1 =rg.Point3d.Add(point0, planeLoad.XAxis*l2*0.5 + planeLoad.YAxis*l2*0.5)
        point2 =rg.Point3d.Add(point0, planeLoad.XAxis*l2*0.5 - planeLoad.YAxis*l2*0.5)
        point3 =rg.Point3d.Add(point0, -planeLoad.XAxis*l2*0.5 - planeLoad.YAxis*l2*0.5)
        point4 = rg.Point3d.Add( point0, -planeLoad.XAxis*l2*0.5 + planeLoad.YAxis*l2*0.5)
        Arrow.Vertices.Add( point1 ) #5
        Arrow.Vertices.Add( point2 ) #6
        Arrow.Vertices.Add( point3 ) #7
        Arrow.Vertices.Add( point4 ) #8
        Arrow.Faces.AddFace( 0, 5, 6 ) 
        Arrow.Faces.AddFace( 0, 6, 7 )
        Arrow.Faces.AddFace( 0, 7, 8 )
        Arrow.Faces.AddFace( 0, 8, 5 )
        Arrow.Faces.AddFace( 5, 6, 7, 8)
        Arrow.VertexColors.CreateMonotoneMesh( color )
        vectorDraw.append( Arrow )
    return vectorDraw 

colour1 = rs.CreateColor( 255, 255, 255 )
colour2 = rs.CreateColor( 255, 100, 0 )
Force = DrawVector( PointLoad, scale, False, colour1)
Moment = DrawVector( PointLoad, scale, True, colour2)
# ---------- end python_7 ----------
python_8 = GhPythonScript(model=am.AlpacaModel, scale=number_slider_10)  # disabled
# ---------- python_8: Python ----------
from ghpythonlib.componentbase import executingcomponent as component
import Grasshopper, GhPython
import System
import Rhino as rc
import rhinoscriptsyntax as rs

class MyComponent(component):
    
    def RunScript(self, model, scale):
        import sys
        import Rhino.Geometry as rg
        import Grasshopper as gh
        import copy
        import rhinoscriptsyntax as rs
        import System.Drawing.Color
        import Rhino
        import math as mt
        
        model = model
        scale = scale
        
        ghcompfolder = gh.Folders.DefaultAssemblyFolder
        if ghcompfolder not in sys.path:
            sys.path.append(ghcompfolder)
        
        try:
            from Alpaca4d import alpaca4dView as alpacaView
        except:
            msg = "Cannot import Alpaca4d. Is the Alpaca4d folder available in " + ghcompfolder + "?"
            ghenv.Component.AddRuntimeMessage(gh.Kernel.GH_RuntimeMessageLevel.Error, msg)
        
        self.solidSupport = [ alpacaView.Support( iSupport, scale ) for iSupport in model.supports ]
        
    def DrawViewportWires(self,arg):
        # Support
        color = System.Drawing.Color.Azure
        colorWirframe = System.Drawing.Color.Black
        colorMaterial = rc.Display.DisplayMaterial(color, 0.0)
        for iSupport in self.solidSupport :
            arg.Display.DrawBrepShaded( iSupport, colorMaterial)
            arg.Display.DrawBrepWires( iSupport, colorWirframe)
# ---------- end python_8 ----------

# ---- group: CDS
number_slider_11 = Slider(3, range=0..100)  # disabled
toggle_4 = BooleanToggle(False)  # disabled
bf = BeamForcesAlpaca4d(AlpacaSolvedModel=ra.AlpacaSolvedModel, step=number_slider_11, History=toggle_4)  # -> out, N, M2, T1, M1, T2, Mz; inputs step: Int32, History: Boolean; disabled
# ---------- bf: Python ----------
"""
Valor of internal beam forces

    Args:
        AlpacaSolvedModel:
        step:
        History:
    Returns:
        N: forces in direction 3  (Axial Force)
        M2: Moments around axis 2 (Bending Moment 1)
        T1: forces in direction 1 (Shear Force 1)
        M1: Moments around axis 1 (Bending Moment 2)
        T2: forces in direction 2 (Shear Force 2)
        Mt: Moments around axis 3 (Twisting Moment)
"""

import sys
import os
import System
from System.Drawing import Color
import clr
import clrtype
import Rhino.Geometry as rg
import rhinoscriptsyntax as rs
import Grasshopper as gh
import copy
import ghpythonlib.treehelpers as th


ghenv.Component.Name = "Beam Forces (Alpaca4d)"
ghenv.Component.NickName = 'BF'
ghenv.Component.Message = "Beam Forces (Alpaca4d)"
## add alpaca install directory to system path

ghcompfolder = gh.Folders.DefaultAssemblyFolder
if ghcompfolder not in sys.path:
    sys.path.append(ghcompfolder)

try:
    from Alpaca4d import alpaca4d as alpaca
except:
    msg = "Cannot import Alpaca4d. Is the Alpaca4d folder available in " + ghcompfolder + "?"
    ghenv.Component.AddRuntimeMessage(gh.Kernel.GH_RuntimeMessageLevel.Error, msg)



FolderPath = rs.DocumentPath()
os.chdir(FolderPath)


# import costum modules to read the hdf5 file

my_module_name = "Alpaca_StepReader"
my_module = sys.modules.setdefault(my_module_name, type(sys)(my_module_name))

hdfFilePath = os.path.join(ghcompfolder, "Alpaca4d\HDF5CSharp.dll")
clr.AddReferenceToFileAndPath(hdfFilePath)

from HDF5CSharp import Hdf5

try:
    Steps = my_module.Steps
except AttributeError:
    type_2d = type(System.Array.CreateInstance(float, 1, 1))

    class Steps(object):
        __metaclass__ = clrtype.ClrClass
        _clrfields = {"STEP_{}".format(i): type_2d for i in range(1000)} # it will work for model with less than 1000 steps

    my_module.Steps = Steps


checkData = True

if not AlpacaSolvedModel:
    checkData = False
    msg = "Input parameter AlpacaSolvedModel failed to collect data"
    ghenv.Component.AddRuntimeMessage(gh.Kernel.GH_RuntimeMessageLevel.Warning, msg)

if checkData:
    
    step = (int(AlpacaSolvedModel.analysis.NumberOfSteps) - 1) if step is None else step
# read result
    
    N = []
    T1 = []
    T2 = []
    M1 = []
    M2 = []
    Mz = []
    
    fileId = Hdf5.OpenFile(AlpacaSolvedModel.recorderName, True)
    
    stressResult = Hdf5.ReadObject[Steps](fileId, "/MODEL_STAGE[1]/RESULTS/ON_ELEMENTS/section.force/74-ForceBeamColumn3d[1000:1:0]/DATA")
    #stressResult = Hdf5.ReadObject[Steps](fileId, "/MODEL_STAGE[1]/RESULTS/ON_ELEMENTS/stresses/167-UnknownMovableObject[103:0:0]/DATA")
if History is True:
    
    maxNumberStep = int(AlpacaSolvedModel.analysis.NumberOfSteps)
    for istep in range(maxNumberStep):
        for i,item in enumerate(AlpacaSolvedModel.beams):
            ni = 5 # potrebbe cambiare per ogni trave
            Ni = [ getattr(stressResult, 'STEP_{}'.format(istep))[i,j] for j in range(0,ni*6, 6)]
            M2i = [ getattr(stressResult, 'STEP_{}'.format(istep))[i,j] for j in range(1,ni*6, 6)]  
            T1i = [ getattr(stressResult, 'STEP_{}'.format(istep))[i,j] for j in range(2,ni*6, 6)]
            M1i = [ getattr(stressResult, 'STEP_{}'.format(istep))[i,j] for j in range(3,ni*6, 6)]
            T2i = [ getattr(stressResult, 'STEP_{}'.format(istep))[i,j] for j in range(4,ni*6, 6)]
            Mzi = [ getattr(stressResult, 'STEP_{}'.format(istep))[i,j] for j in range(5,ni*6, 6)]
            
            N.append([Ni])
            M2.append([M2i])
            T1.append([T1i])
            M1.append([M1i])
            T2.append([T2i])
            Mz.append([Mzi])
else:
    for i,item in enumerate(AlpacaSolvedModel.beams):
        ni = 5 # potrebbe cambiare per ogni trave
        Ni = [ getattr(stressResult, 'STEP_{}'.format(step))[i,j] for j in range(0,ni*6, 6)]
        M2i = [ getattr(stressResult, 'STEP_{}'.format(step))[i,j] for j in range(1,ni*6, 6)]  
        T1i = [ getattr(stressResult, 'STEP_{}'.format(step))[i,j] for j in range(2,ni*6, 6)]
        M1i = [ getattr(stressResult, 'STEP_{}'.format(step))[i,j] for j in range(3,ni*6, 6)]
        T2i = [ getattr(stressResult, 'STEP_{}'.format(step))[i,j] for j in range(4,ni*6, 6)]
        Mzi = [ getattr(stressResult, 'STEP_{}'.format(step))[i,j] for j in range(5,ni*6, 6)]
        
        N.append([Ni])
        M2.append([M2i])
        T1.append([T1i])
        M1.append([M1i])
        T2.append([T2i])
        Mz.append([Mzi])
        
Hdf5.CloseFile(fileId)

N = th.list_to_tree(N)
M2 = th.list_to_tree(M2)
T1 = th.list_to_tree(T1)
M1 = th.list_to_tree(M1)
T2 = th.list_to_tree(T2)
Mz = th.list_to_tree(Mz)
# ---------- end bf ----------
graph = QuickGraph(bf.M2, SortOrder=0)  # disabled

# ----
number_slider_12 = Slider(0, range=0..10)  # disabled
bfd = BeamForcesDiagramAlpaca4d(cdsType=Slider(0, range=0..10), scale="0.001")  # -> ForcesDiagram; inputs step: Int32, cdsType: Int32
# ---------- bfd: Python ----------
"""
View Diagram of internal beam forces

    Args:
        AlpacaModel:
        cdsType: 
    0: to view N (forces in direction 3)
    1: to view M2 (Moments around axis 2)
    2: to view T1 (forces in direction 1)
    3: to view M1 (Moments around axis 1)
    4: to view T2 (forces in direction 2)
    5: to view Mt (Moments around axis 3)
        step:
        scale: scalar view
        viewValor: to view tthe force value
    Returns:
        ForcesDiagram: Diagram of internal beam forces
"""


ghenv.Component.Name = "BeamForcesDiagram (Alpaca4d)"
ghenv.Component.NickName = 'BFD'
ghenv.Component.Message = "Beam Forces Diagram (Alpaca4d)"

from ghpythonlib.componentbase import executingcomponent as component
import Grasshopper, GhPython
import rhinoscriptsyntax as rs
import sys
import os
import System
import clr
import Rhino.Geometry as rg
import Grasshopper as gh
import copy
import Rhino


from Alpaca4d import alpaca4d as alpaca
from Alpaca4d import alpaca4dView as alpacaView
FolderPath = rs.DocumentPath()
os.chdir(FolderPath)

ghcompfolder = gh.Folders.DefaultAssemblyFolder
if ghcompfolder not in sys.path:
    sys.path.append(ghcompfolder)

# import costum modules to read the hdf5 file
my_module_name = "Alpaca_StepReader"
my_module = sys.modules.setdefault(my_module_name, type(sys)(my_module_name))

hdfFilePath = os.path.join(ghcompfolder, "Alpaca4d\HDF5CSharp.dll")
clr.AddReferenceToFileAndPath(hdfFilePath)

from HDF5CSharp import Hdf5

try:
    Steps = my_module.Steps
except AttributeError:
    type_2d = type(System.Array.CreateInstance(float, 1, 1))

    class Steps(object):
        __metaclass__ = clrtype.ClrClass
        _clrfields = {"STEP_{}".format(i): type_2d for i in range(1000)} # it will work for model with less than 1000 steps
    
    my_module.Steps = Steps

checkData = True

class MyComponent(component):
    
    def RunScript(self, AlpacaSolvedModel, step, cdsType, scale, viewValor):
        
        self.viewValor = viewValor
        
        if not AlpacaSolvedModel:
            checkData = False
            msg = "Input parameter AlpacaSolvedModel failed to collect data"
            ghenv.Component.AddRuntimeMessage(gh.Kernel.GH_RuntimeMessageLevel.Warning, msg)
        else:
                    
            fileId = Hdf5.OpenFile(AlpacaSolvedModel.recorderName, True)
            
            stressResult = Hdf5.ReadObject[Steps](fileId, "/MODEL_STAGE[1]/RESULTS/ON_ELEMENTS/section.force/74-ForceBeamColumn3d[1000:1:0]/DATA")
            #stressResult = Hdf5.ReadObject[Steps](fileId, "/MODEL_STAGE[1]/RESULTS/ON_ELEMENTS/stresses/167-UnknownMovableObject[103:0:0]/DATA")
            if cdsType <= 0:
                versorType, startRange, colorPos, colorNeg = 1, 0, System.Drawing.Color.SteelBlue, System.Drawing.Color.LightSalmon
            elif cdsType == 1:
                versorType, startRange, colorPos, colorNeg = 1, 1, System.Drawing.Color.Aqua, System.Drawing.Color.IndianRed
            elif cdsType== 2:
                versorType, startRange, colorPos, colorNeg = 1, 2, System.Drawing.Color.LightSalmon, System.Drawing.Color.LightSalmon
            elif cdsType == 3:
                versorType, startRange, colorPos, colorNeg = 2, 3, System.Drawing.Color.SteelBlue, System.Drawing.Color.Yellow
            elif cdsType == 4:
                versorType, startRange, colorPos, colorNeg = 2, 4, System.Drawing.Color.LawnGreen, System.Drawing.Color.LawnGreen
            else:
                versorType, startRange, colorPos, colorNeg = 2, 5, System.Drawing.Color.BlueViolet, System.Drawing.Color.BlueViolet
            
            if scale is None : scale = 0.0025
            if step is None :  step = (int(AlpacaSolvedModel.analysis.NumberOfSteps) - 1) if step is None else step
            
            CDSView = []
            CDSPoint = []
            CDSValor = []
        
            for i,item in enumerate(AlpacaSolvedModel.beams):
                ni = 5 # potrebbe cambiare per ogni trave
                #Versore
                e = item.getPerpFrame()[versorType]*-1
                print(e)
                valor = [ getattr(stressResult, 'STEP_{}'.format(step))[i,j] for j in range(startRange,ni*6, 6)]
                print(valor)
                cdsVector = [ rg.Vector3d.Multiply(e, ivalor*scale) for ivalor in valor ]
                #----------------------------------------------------------------#
                cdsView, cdsPoint = alpacaView.cdsMesh( item, cdsVector, colorPos, colorNeg)
                CDSView.append(cdsView)
                CDSPoint.append(cdsPoint)
                CDSValor.append(valor)
                
            Hdf5.CloseFile(fileId)
            
            self.Pos = CDSPoint
            self.Valor = CDSValor
            self.ForcesDiagram = CDSView
            
    
            return self.ForcesDiagram
        
    def DrawViewportWires(self,arg):
        # node Tag view
        for iPos, ivalor, iMesh in zip(self.Pos, self.Valor, self.ForcesDiagram) :
            colorWirframe = System.Drawing.Color.Black
            arg.Display.DrawMeshWires(iMesh, colorWirframe)
            if self.viewValor is True:
                for jpos, jvalor in zip(iPos, ivalor):
                    t = 25
                    txt = str( round( jvalor, 2))
                    arg.Display.Draw2dText( txt, System.Drawing.Color.Black, jpos, True, t)
# ---------- end bfd ----------

# ---- group: Ho messo la visualizzazione delle forze
toggle_5 = BooleanToggle(False)  # disabled
rf = ReactionForcesAlpaca4d(AlpacaModel=ra.AlpacaSolvedModel, History=toggle_5)  # -> SupportPosition, ReactionForce, ReactionMoment; inputs History: Boolean, step: Int32; disabled
# ---------- rf: Python ----------
"""
Read Reaction Forces
    Args:
        AlpacaModel:
        History:
        step:
    Returns:
        SupportPosition:
        ReactionForce:
        ReactionMoment:
        ReactionForce_History:
        ReactionMoment_History:

from ghpythonlib.componentbase import executingcomponent as component

"""
from ghpythonlib.componentbase import executingcomponent as component

ghenv.Component.Name = "Reaction Forces (Alpaca4d)"
ghenv.Component.NickName = 'RF'
ghenv.Component.Message = 'Reaction Forces (Alpaca4d)'

import ghpythonlib.components as ghcomp
import sys
import os
import System
import clr
import clrtype
import Rhino.Geometry as rg
import rhinoscriptsyntax as rs
import Grasshopper as gh
import copy
import ghpythonlib.treehelpers as th


## add alpaca install directory to system path

ghcompfolder = gh.Folders.DefaultAssemblyFolder
if ghcompfolder not in sys.path:
    sys.path.append(ghcompfolder)

try:
    from Alpaca4d import alpaca4d as alpaca
except:
    msg = "Cannot import Alpaca4d. Is the Alpaca4d folder available in " + ghcompfolder + "?"
    ghenv.Component.AddRuntimeMessage(gh.Kernel.GH_RuntimeMessageLevel.Error, msg)
    
ghcompfolder = gh.Folders.DefaultAssemblyFolder
if ghcompfolder not in sys.path:
    sys.path.append(ghcompfolder)

try:
    from Alpaca4d import alpaca4d as alpaca
except:
    msg = "Cannot import Alpaca4d. Is the Alpaca4d folder available in " + ghcompfolder + "?"
    ghenv.Component.AddRuntimeMessage(gh.Kernel.GH_RuntimeMessageLevel.Error, msg)

FolderPath = rs.DocumentPath()
os.chdir(FolderPath)

my_module_name = "Alpaca_StepReader" # replace this with something unique that doesn't collide with a real module!
my_module = sys.modules.setdefault(my_module_name, type(sys)(my_module_name))

hdfFilePath = os.path.join(ghcompfolder, "Alpaca4d\HDF5CSharp.dll")
clr.AddReferenceToFileAndPath(hdfFilePath)


from HDF5CSharp import Hdf5

try:
    Steps = my_module.Steps
except AttributeError:
    type_2d = type(System.Array.CreateInstance(float, 1, 1))

    class Steps(object):
        __metaclass__ = clrtype.ClrClass
        _clrfields = {"STEP_{}".format(i): type_2d for i in range(1000)} # it will work for model with less than 1000 steps

    my_module.Steps = Steps
    
class MyComponent(component):
    
    def RunScript(self, AlpacaModel, History, step):
        ## add alpaca install directory to system path
        checkData = True
        
        if not AlpacaModel:
            checkData = False
            msg = "Input parameter AlpacaModel failed to collect data"
            ghenv.Component.AddRuntimeMessage(gh.Kernel.GH_RuntimeMessageLevel.Warning, msg)
        
        History = False if History is None else History
        
        
        if checkData:
            step = (int(AlpacaModel.analysis.NumberOfSteps) - 1) if step is None else step
            supportTagLocation = [item.nodeTag - 1 for item in AlpacaModel.supports] #
            
            if not History:
            
                try:
                    fileId = Hdf5.OpenFile(AlpacaModel.recorderName, True)
                    
                    
                    reactionForceResult = Hdf5.ReadObject[Steps](fileId, "/MODEL_STAGE[1]/RESULTS/ON_NODES/REACTION_FORCE/DATA")
                    ReactionForce = []
                    for i in supportTagLocation:
                        x = getattr(reactionForceResult, 'STEP_{}'.format(step))[i,0]
                        y = getattr(reactionForceResult, 'STEP_{}'.format(step))[i,1]
                        z = getattr(reactionForceResult, 'STEP_{}'.format(step))[i,2]
                        ReactionForce.append(rg.Vector3d(x,y,z))
                    
                    
                    ReactionMomentResult = Hdf5.ReadObject[Steps](fileId, "/MODEL_STAGE[1]/RESULTS/ON_NODES/REACTION_MOMENT/DATA")
                    ReactionMoment = []
                    for i in supportTagLocation:
                        x = getattr(ReactionMomentResult, 'STEP_{}'.format(step))[i,0]
                        y = getattr(ReactionMomentResult, 'STEP_{}'.format(step))[i,1]
                        z = getattr(ReactionMomentResult, 'STEP_{}'.format(step))[i,2]
                        ReactionMoment.append(rg.Vector3d(x,y,z))
                        
                    Hdf5.CloseFile(fileId)
                    self.RForce = ReactionForce
                    self.RMoment = ReactionMoment
                    self.forceBounds = ghcomp.Bounds(self.RForce)
                    self.momentBounds = ghcomp.Bounds(self.RMoment)
                    print(len(self.RForce), len(self.RMoment))
                except:
                    if fileId >0:
                        Hdf5.CloseFile(fileId)
                        print("I have closed the file")
                        
            
            if History:
                try:
                    fileId = Hdf5.OpenFile(AlpacaModel.recorderName, True)
                
                    maxNumberStep = int(AlpacaModel.analysis.NumberOfSteps)
                    
                    reactionForceResult = Hdf5.ReadObject[Steps](fileId, "/MODEL_STAGE[1]/RESULTS/ON_NODES/REACTION_FORCE/DATA")
                    ReactionForce = []
                    for i in supportTagLocation:
                        reactionForceTemp = []
                        for n_step in range(maxNumberStep):
                            x = getattr(reactionForceResult, 'STEP_{}'.format(n_step))[i,0]
                            y = getattr(reactionForceResult, 'STEP_{}'.format(n_step))[i,1]
                            z = getattr(reactionForceResult, 'STEP_{}'.format(n_step))[i,2]
                            reactionForceTemp.append(rg.Vector3d(x,y,z))
                    
                        ReactionForce.append(reactionForceTemp)
            
            
                    reactionMomentResult = Hdf5.ReadObject[Steps](fileId, "/MODEL_STAGE[1]/RESULTS/ON_NODES/REACTION_MOMENT/DATA")
                    ReactionMoment = []
                    for i in supportTagLocation:
                        reactionMomentTemp = []
                        for n_step in range(maxNumberStep):
                            x = getattr(reactionMomentResult, 'STEP_{}'.format(n_step))[i,0]
                            y = getattr(reactionMomentResult, 'STEP_{}'.format(n_step))[i,1]
                            z = getattr(reactionMomentResult, 'STEP_{}'.format(n_step))[i,2]
                            reactionMomentTemp.append(rg.Vector3d(x,y,z))
                    
                        ReactionMoment.append(reactionMomentTemp)
                    Hdf5.CloseFile(fileId)
                    
                except:
                    Hdf5.CloseFile(fileId)
            
            SupportPosition = [item.Pos for item in AlpacaModel.supports]
            ReactionForce = th.list_to_tree(ReactionForce)
            ReactionMoment = th.list_to_tree(ReactionMoment)
            
            if History is False:
                self.SPos = SupportPosition
            else:
                self.SPos = []
                
        # return outputs if you have them; here I try it for you:
        return (SupportPosition, ReactionForce, ReactionMoment)
        
    def DrawViewportWires(self,arg):
        for iPos, iForce, iMoment in zip(self.SPos, self.RForce, self.RMoment) :
            arg.Display.DrawArrow( rg.Line(iPos, iForce/self.forceBounds[1]),  System.Drawing.Color.DarkRed)
            arg.Display.DrawArrow( rg.Line(iPos, iMoment/self.momentBounds[1]),  System.Drawing.Color.DarkBlue)
# ---------- end rf ----------
# ----
vbs = ViewBrickStressesAlpaca4d(step=Slider(0, range=0..10), stressType=Slider(0, range=0..10))  # -> out, Brick, bounds; inputs step: Int32, stressType: Int32, listColor: list of Color
# ---------- vbs: Python ----------
"""
Read Brick Stresses
-
    Args:
        AlpacaSolvedModel:
        step:
        stressType: 
 <=0: sigma_xx
 1: sigma_yy
 2: sigma_zz
 3: tau_xy
 4: tau_xz
 5: tau_yz
 >=6: sigma_VM (Von Mises criterion)
        listColor : one list of color 
    Returns:
"""

ghenv.Component.Name = "View Brick Stresses (Alpaca4d)"
ghenv.Component.NickName = 'VBS'
ghenv.Component.Message = "View Brick Stresses (Alpaca4d)"

import sys
import os
import System
from System.Drawing import Color


import clr
import clrtype
import Rhino.Geometry as rg
import rhinoscriptsyntax as rs
import Grasshopper as gh
import copy
import ghpythonlib.treehelpers as th
from ghpythonlib.components import Bounds
import math as mt

## add alpaca install directory to system path

ghcompfolder = gh.Folders.DefaultAssemblyFolder
if ghcompfolder not in sys.path:
    sys.path.append(ghcompfolder)

try:
    from Alpaca4d import alpaca4d as alpaca
    from Alpaca4d import alpaca4dView as alpacaView
except:
    msg = "Cannot import Alpaca4d. Is the Alpaca4d folder available in " + ghcompfolder + "?"
    ghenv.Component.AddRuntimeMessage(gh.Kernel.GH_RuntimeMessageLevel.Error, msg)



FolderPath = rs.DocumentPath()
os.chdir(FolderPath)


# import costum modules to read the hdf5 file

my_module_name = "Alpaca_StepReader"
my_module = sys.modules.setdefault(my_module_name, type(sys)(my_module_name))

hdfFilePath = os.path.join(ghcompfolder, "Alpaca4d\HDF5CSharp.dll")
clr.AddReferenceToFileAndPath(hdfFilePath)

from HDF5CSharp import Hdf5

try:
    Steps = my_module.Steps
except AttributeError:
    type_2d = type(System.Array.CreateInstance(float, 1, 1))

    class Steps(object):
        __metaclass__ = clrtype.ClrClass
        _clrfields = {"STEP_{}".format(i): type_2d for i in range(1000)} # it will work for model with less than 1000 steps

    my_module.Steps = Steps

if stressType is None or stressType <0 : stressType = 0
elif stressType >= 6 : stressType = 6

if not listColor: listColor = [ System.Drawing.Color.DarkBlue, 
                                System.Drawing.Color.RoyalBlue, 
                                System.Drawing.Color.CornflowerBlue,
                                System.Drawing.Color.LightSkyBlue, 
                                System.Drawing.Color.LightBlue,
                                System.Drawing.Color.CadetBlue,
                                System.Drawing.Color.White,
                                System.Drawing.Color.Yellow,
                                System.Drawing.Color.Orange,
                                System.Drawing.Color.Red,
                                System.Drawing.Color.DarkRed]

checkData = True

if not AlpacaSolvedModel:
    checkData = False
    msg = "Input parameter AlpacaSolvedModel failed to collect data"
    ghenv.Component.AddRuntimeMessage(gh.Kernel.GH_RuntimeMessageLevel.Warning, msg)

if checkData:
    
    step = (int(AlpacaSolvedModel.analysis.NumberOfSteps) - 1) if step is None else step
# read result
    stress = []
    fileId = Hdf5.OpenFile(AlpacaSolvedModel.recorderName, True)
    solidSortedByeleTag = sorted(AlpacaSolvedModel.bricks, key=lambda x: x.eleTag)
    
    solidStandardBrick = []
    solidSSPBrick = []
    solidTetra = []
    
    for item in solidSortedByeleTag:
        if item.elementType == "stdBrick": 
            solidStandardBrick.append(item)
        elif item.elementType == "SSPbrick":
            solidSSPBrick.append(item)
        elif item.elementType == "FourNodeTetrahedron":
            solidTetra.append(item)
    
    solidElements1GP = [solidSSPBrick , solidTetra]
    
    #BRICK
    stressResultSSPBrick = Hdf5.ReadObject[Steps](fileId, "/MODEL_STAGE[1]/RESULTS/ON_ELEMENTS/stresses/121-UnknownMovableObject[400:0:0]/DATA")
    stressResultStandardBrick = Hdf5.ReadObject[Steps](fileId, "/MODEL_STAGE[1]/RESULTS/ON_ELEMENTS/stresses/56-Brick[401:0:0]/DATA")
    
    #TETRA
    stressResultFNTetra = Hdf5.ReadObject[Steps](fileId, "/MODEL_STAGE[1]/RESULTS/ON_ELEMENTS/stresses/179-FourNodeTetrahedron[300:0:0]/DATA")
    #BrickMesh = 
    for j,stressResult in enumerate([stressResultSSPBrick, stressResultFNTetra]):
        for i in range(len(solidElements1GP[j])):
            sigma_xx = getattr(stressResult, 'STEP_{}'.format(step))[i,0]
            sigma_yy = getattr(stressResult, 'STEP_{}'.format(step))[i,1]
            sigma_zz = getattr(stressResult, 'STEP_{}'.format(step))[i,2]
            tau_xy = getattr(stressResult, 'STEP_{}'.format(step))[i,3]
            tau_xz = getattr(stressResult, 'STEP_{}'.format(step))[i,4]
            tau_yz = getattr(stressResult, 'STEP_{}'.format(step))[i,5]
            
            #print(sigma_xx, sigma_yy, sigma_zz, tau_xy, tau_xz, tau_yz)
            #print((sigma_xx - sigma_yy)**2 + (sigma_yy - sigma_zz)**2 + (sigma_zz - sigma_xx)**2 +  6*(tau_xy**2 + tau_yz**2 + tau_xz**2))
            #sigma_VM = mt.sqrt( (sigma_xx**2 + sigma_yy**2 + sigma_zz**2)  - (sigma_xx*sigma_yy + sigma_yy*sigma_zz + sigma_zz*sigma_yy) + 3*(tau_xy**2 + tau_yz**2 + tau_xz**2))
            sigma_VM = (1/mt.sqrt(2))*mt.sqrt(mt.pow(sigma_xx - sigma_yy,2) + mt.pow(sigma_yy - sigma_zz,2) + mt.pow(sigma_zz - sigma_xx,2) +  6*(mt.pow(tau_xy,2) + mt.pow(tau_yz,2) + mt.pow(tau_xz,2)))
            
            stress.append([ sigma_xx, sigma_yy, sigma_zz, tau_xy, tau_xz, tau_yz, sigma_VM ]) 
            
    Hdf5.CloseFile(fileId)
    print("I have close the file")
    
    ListValor = [ row[stressType] for row in stress ]
    print(ListValor)
    bounds = Bounds(ListValor)
    solidElements1GP = solidSSPBrick + solidTetra
    print( bounds )
    Brick = alpacaView.ColorBrickStress( solidElements1GP, ListValor, bounds, listColor)
# ---------- end vbs ----------
vss = ViewShellStressesAlpaca4d(stressType=Slider(0, range=0..10))  # -> out, Shell; inputs step: Int32, stressType: Int32, listColor: list of Color
# ---------- vss: Python ----------
"""
Read Shell Stresses
-
    Args:
        AlpacaModel:
        step:
    Returns:
        p11:
        p22:
        p12:
        m11:
        m22:
        m12:
        q1:
        q2:
"""

ghenv.Component.Name = "View Shell Stresses (Alpaca4d)"
ghenv.Component.NickName = 'VSS'
ghenv.Component.Message = "View Shell Stresses (Alpaca4d)"

import sys
import os
import System
from System.Drawing import Color


import clr
import clrtype
import Rhino.Geometry as rg
import rhinoscriptsyntax as rs
import Grasshopper as gh
import copy
import ghpythonlib.treehelpers as th
from ghpythonlib.components import Bounds
import math as mt


## add alpaca install directory to system path

ghcompfolder = gh.Folders.DefaultAssemblyFolder
if ghcompfolder not in sys.path:
    sys.path.append(ghcompfolder)

try:
    from Alpaca4d import alpaca4d as alpaca
    from Alpaca4d import alpaca4dView as alpacaView
except:
    msg = "Cannot import Alpaca4d. Is the Alpaca4d folder available in " + ghcompfolder + "?"
    ghenv.Component.AddRuntimeMessage(gh.Kernel.GH_RuntimeMessageLevel.Error, msg)



FolderPath = rs.DocumentPath()
os.chdir(FolderPath)


# import costum modules to read the hdf5 file

my_module_name = "Alpaca_StepReader"
my_module = sys.modules.setdefault(my_module_name, type(sys)(my_module_name))

hdfFilePath = os.path.join(ghcompfolder, "Alpaca4d\HDF5CSharp.dll")
clr.AddReferenceToFileAndPath(hdfFilePath)

from HDF5CSharp import Hdf5

try:
    Steps = my_module.Steps
except AttributeError:
    type_2d = type(System.Array.CreateInstance(float, 1, 1))

    class Steps(object):
        __metaclass__ = clrtype.ClrClass
        _clrfields = {"STEP_{}".format(i): type_2d for i in range(1000)} # it will work for model with less than 1000 steps

    my_module.Steps = Steps


checkData = True

if not AlpacaSolvedModel:
    checkData = False
    msg = "Input parameter AlpacaModel failed to collect data"
    ghenv.Component.AddRuntimeMessage(gh.Kernel.GH_RuntimeMessageLevel.Warning, msg)
    
if stressType is None or stressType <0 : stressType = 0
elif stressType >= 7 : stressType = 7

if not listColor: listColor = [ System.Drawing.Color.DarkBlue, 
                                System.Drawing.Color.RoyalBlue, 
                                System.Drawing.Color.CornflowerBlue,
                                System.Drawing.Color.LightSkyBlue, 
                                System.Drawing.Color.LightBlue,
                                System.Drawing.Color.CadetBlue,
                                System.Drawing.Color.White,
                                System.Drawing.Color.Yellow,
                                System.Drawing.Color.Orange,
                                System.Drawing.Color.Red,
                                System.Drawing.Color.DarkRed]
if checkData:
    
    step = (int(AlpacaSolvedModel.analysis.NumberOfSteps) - 1) if step is None else step
# read result
    
    
    ## to fix the issue about index of different type of object
    

    fileId = Hdf5.OpenFile(AlpacaSolvedModel.recorderName, True)
    
    shellSortedByeleTag = sorted(AlpacaSolvedModel.shells, key=lambda x: x.eleTag)
    
    ShellDKGT = []
    ShellMITC4 = []
    ASDShellQ4 = []
    
    
    for item in shellSortedByeleTag:
        if item.elementType == "ShellDKGT":
            ShellDKGT.append(item)
        elif item.elementType == "ShellMITC4":
            ShellMITC4.append(item)
        elif item.elementType == "ASDShellQ4":
            ASDShellQ4.append(item)
    
    shellElements = [ShellDKGT, ShellMITC4, ASDShellQ4]
    
    #shellMITC4
    stressResultMITC4 = Hdf5.ReadObject[Steps](fileId, "/MODEL_STAGE[1]/RESULTS/ON_ELEMENTS/stresses/53-UnknownMovableObject[201:0:0]/DATA")
    #ShellNLDKGT
    stressResultNLDKGT = Hdf5.ReadObject[Steps](fileId, "/MODEL_STAGE[1]/RESULTS/ON_ELEMENTS/stresses/167-UnknownMovableObject[103:0:0]/DATA")
    #asdea shell
    stressResultASDShellQ4 = Hdf5.ReadObject[Steps](fileId, "/MODEL_STAGE[1]/RESULTS/ON_ELEMENTS/stresses/203-UnknownMovableObject[201:0:0]/DATA")
    
    stress = []
    
    for j,stressResult in enumerate([stressResultNLDKGT, stressResultMITC4, stressResultASDShellQ4]):
        for i in range(len(shellElements[j])):
            p11_0 = getattr(stressResult, 'STEP_{}'.format(step))[i,0]
            p11_1 = getattr(stressResult, 'STEP_{}'.format(step))[i,8]
            p11_2 = getattr(stressResult, 'STEP_{}'.format(step))[i,16]
            p11_3 = getattr(stressResult, 'STEP_{}'.format(step))[i,24]
            
            p11 = [p11_0,p11_1,p11_2,p11_3]
            
            
            p22_0 = getattr(stressResult, 'STEP_{}'.format(step))[i,1]
            p22_1 = getattr(stressResult, 'STEP_{}'.format(step))[i,9]
            p22_2 = getattr(stressResult, 'STEP_{}'.format(step))[i,17]
            p22_3 = getattr(stressResult, 'STEP_{}'.format(step))[i,25]
            
            p22 = [p22_0,p22_1,p22_2,p22_3]
            
            
            p12_0 = getattr(stressResult, 'STEP_{}'.format(step))[i,2]
            p12_1 = getattr(stressResult, 'STEP_{}'.format(step))[i,10]
            p12_2 = getattr(stressResult, 'STEP_{}'.format(step))[i,18]
            p12_3 = getattr(stressResult, 'STEP_{}'.format(step))[i,26]
            
            p12 = [p12_0,p12_1,p12_2,p12_3]
            
            
            m11_0 = getattr(stressResult, 'STEP_{}'.format(step))[i,3]
            m11_1 = getattr(stressResult, 'STEP_{}'.format(step))[i,11]
            m11_2 = getattr(stressResult, 'STEP_{}'.format(step))[i,19]
            m11_3 = getattr(stressResult, 'STEP_{}'.format(step))[i,27]
            
            m11 = [m11_0,m11_1,m11_2,m11_3]
            
            
            m22_0 = getattr(stressResult, 'STEP_{}'.format(step))[i,4]
            m22_1 = getattr(stressResult, 'STEP_{}'.format(step))[i,12]
            m22_2 = getattr(stressResult, 'STEP_{}'.format(step))[i,20]
            m22_3 = getattr(stressResult, 'STEP_{}'.format(step))[i,28]
            
            m22 = [m22_0,m22_1,m22_2,m22_3]
            
            
            m12_0 = getattr(stressResult, 'STEP_{}'.format(step))[i,5]
            m12_1 = getattr(stressResult, 'STEP_{}'.format(step))[i,13]
            m12_2 = getattr(stressResult, 'STEP_{}'.format(step))[i,21]
            m12_3 = getattr(stressResult, 'STEP_{}'.format(step))[i,29]
            
            m12 = [m12_0,m12_1,m12_2,m12_3]
            
            
            q1_0 = getattr(stressResult, 'STEP_{}'.format(step))[i,6]
            q1_1 = getattr(stressResult, 'STEP_{}'.format(step))[i,14]
            q1_2 = getattr(stressResult, 'STEP_{}'.format(step))[i,22]
            q1_3 = getattr(stressResult, 'STEP_{}'.format(step))[i,30]
            
            q1 = [q1_0,q1_1,q1_2,q1_3]
            
            
            q2_0 = getattr(stressResult, 'STEP_{}'.format(step))[i,7]
            q2_1 = getattr(stressResult, 'STEP_{}'.format(step))[i,15]
            q2_2 = getattr(stressResult, 'STEP_{}'.format(step))[i,23]
            q2_3 = getattr(stressResult, 'STEP_{}'.format(step))[i,31]
            
            q2 = [q2_0,q2_1,q2_2,q2_3]
            
            stress.append([ p11, p22, p12, m11, m22, m12, q1, q2 ]) 
            
    Hdf5.CloseFile(fileId)
    print("I have close the file")
    
    ListValor = [ row[stressType] for row in stress ]
    ListFlatten = []
    for i in ListValor:
        for j in i:
            ListFlatten.append(j)
            
    bounds = Bounds(ListFlatten)
    shellElement = ShellDKGT + ShellMITC4 + ASDShellQ4
    print( bounds )
    Shell = alpacaView.ColorShellStress( shellElement, ListValor, bounds, listColor)
            
    Hdf5.CloseFile(fileId)
    print("I have close the file")
    #print( p11[0])
# ---------- end vss ----------
vm = ViewModelAlpaca4d(
    type=Toggle(False),
    nodeTag=Toggle(False),
    eleTag=Toggle(False),
    localAxis=Toggle(True),
    support=Toggle(False),
    load=Toggle(False))  # inputs type: Boolean, nodeTag: Boolean, eleTag: Boolean, localAxis: Boolean, support: Boolean, load: Boolean
# ---------- vm: Python ----------
"""View structural Model
    Inputs:
        AlpacaModel: Output of Assemble Model.
        type: Style of visualize Model 
Default: Visualize the stick Model
True: Visualize the extrude Model
        nodeTag: 
True: Visualize tag nodes
        eleTag: 
True: Visualize tag elements 
        LocalAxes:
True: Visualize local Axis of elements 
        Support: 
True: Visualize support type
        Load: 
True: Visualize load
"""


from ghpythonlib.componentbase import executingcomponent as component
import Grasshopper, GhPython
import System
import ghpythonlib.components as ghcomp

import Rhino as rc
import rhinoscriptsyntax as rs
import sys
import Rhino.Geometry as rg
import Grasshopper as gh
import copy

ghenv.Component.Name = "View Model (Alpaca4d)"
ghenv.Component.NickName = 'VM'
ghenv.Component.Message = "View Model (Alpaca4d)"

ghcompfolder = gh.Folders.DefaultAssemblyFolder
if ghcompfolder not in sys.path:
    sys.path.append(ghcompfolder)
try:
    from Alpaca4d import alpaca4dView as alpacaView
except:
    msg = "Cannot import Alpaca4d. Is the Alpaca4d folder available in " + ghcompfolder + "?"
    ghenv.Component.AddRuntimeMessage(gh.Kernel.GH_RuntimeMessageLevel.Error, msg)

checkData = True

class MyComponent(component):
    
    def RunScript(self, AlpacaModel, type, nodeTag, eleTag, localAxis, support, load):
        
        if not AlpacaModel:
            checkData = False
            msg = "Input parameter AlpacaModel failed to collect data"
            ghenv.Component.AddRuntimeMessage(gh.Kernel.GH_RuntimeMessageLevel.Warning, msg)
        else:
            self.type = type
            
            ## add alpaca install directory to system path
            
            self.ModelBeam = alpacaView.ViewBeam( AlpacaModel, type)
            self.ModelShell = alpacaView.ViewShell( AlpacaModel, type )
            self.ModelBrick = alpacaView.ViewBrick( AlpacaModel)
            #NODE TAG VIEW
            if nodeTag is True:
                self.Nodes = [ [inode.nodeTag, inode.Pos] for inode in AlpacaModel.nodes]
            else:
                self.Nodes = []
            #ELE TAG VIEW
            if eleTag is True:
                TagBeam = [ [item.eleTag, item.getPerpFrame().Origin] for item in AlpacaModel.beams]
                TagShell = [ [item.eleTag, rg.AreaMassProperties.Compute( item.Mesh, False, True, False, False ).Centroid] for item in AlpacaModel.shells]
                TagBrick = [ [item.eleTag, rg.AreaMassProperties.Compute( item.Mesh, False, True, False, False ).Centroid] for item in AlpacaModel.bricks]
                self.TagEle = TagBeam + TagShell + TagBrick
            else:
                self.TagEle = []
            #LOCAL AXIS
            if localAxis is True:
                self.localAxis = [ [item.getPerpFrame().Origin, item.getPerpFrame().XAxis, item.getPerpFrame().YAxis, item.getPerpFrame().ZAxis]   for item in AlpacaModel.beams]
                for item in AlpacaModel.shells:
                    i = item.Mesh.Vertices[0]
                    j = item.Mesh.Vertices[1]
                    curve = rg.LineCurve( i, j )
                    midPoint = rg.AreaMassProperties.Compute( item.Mesh, False, True, False, False ).Centroid
                    vector3 = item.Mesh.Normals[0]
                    vector1 = rg.Curve.PerpendicularFrameAt( curve, 0 )[1].ZAxis
                    vector2 = rg.Vector3d.CrossProduct( vector3, vector1)
                    self.localAxis .append( [midPoint, ghcomp.UnitVector(vector1), ghcomp.UnitVector(vector2), ghcomp.UnitVector(vector3)] )
        
                    
                #rg.Mesh.Vertices
            else:
                self.localAxis = []
            #SUPPORT
            if support is True:
                scale = 0.5
                self.solidSupport = [ alpacaView.Support( iSupport, scale ) for iSupport in AlpacaModel.supports ]
            else:
                self.solidSupport = []
            # LOAD
            if load is True:
                self.viewLoad =[[item.Pos, item.Force, item.Moment] for item in AlpacaModel.loads]
            else:
                self.viewLoad = []
            self.forceBounds = ghcomp.Bounds([ item[1] for item in self.viewLoad])
            self.momentBounds = ghcomp.Bounds([ item[2] for item in self.viewLoad])
            
    def DrawViewportWires(self,arg):
        # Beam
        for iBeam in self.ModelBeam:
            color = iBeam[1]
            colorMaterial = rc.Display.DisplayMaterial(color, 0.3)
            if self.type is True:
                colorWirframe = System.Drawing.Color.Gray
                #System.Drawing.Color.LightGray
                arg.Display.DrawBrepShaded(iBeam[0], colorMaterial)
                arg.Display.DrawBrepWires(iBeam[0], colorWirframe)
            else :
                thickness =2
                arg.Display.DrawCurve(iBeam[0], color, thickness)
        # Mesh
        for iShell in self.ModelShell:
            color = iShell[1]
            #color = System.Drawing.Color.Blue
            colorMaterial = rc.Display.DisplayMaterial(color,color,color,color,1,0.30)
            colorMaterial.IsTwoSided = False
            arg.Display.DrawMeshShaded(iShell[0], colorMaterial)
            colorWirframe = System.Drawing.Color.Black
            arg.Display.DrawMeshWires(iShell[0], colorWirframe)
        #Brick 
        for iBrick in self.ModelBrick:
            color = iBrick[1]
            #color = System.Drawing.Color.Blue
            colorMaterial = rc.Display.DisplayMaterial(color,color,color,color,1,0.30)
            colorMaterial.IsTwoSided = False
            arg.Display.DrawMeshShaded(iBrick[0], colorMaterial)
            colorWirframe = System.Drawing.Color.Black
            arg.Display.DrawMeshWires(iBrick[0], colorWirframe)
            
        # node Tag view
        for inode in self.Nodes:
            arg.Display.Draw2dText( str(inode[0]), System.Drawing.Color.DarkSlateBlue, inode[1], True, 50)
        # ele Tag view
        for iEle in self.TagEle:
            arg.Display.Draw2dText( str(iEle[0]), System.Drawing.Color.BlanchedAlmond, iEle[1], True, 50)
        # local Axis
        for iLocalAxis in self.localAxis:
            c = 0.25
            arg.Display.DrawArrow( rg.Line(iLocalAxis[0], rg.Vector3d.Multiply(c,iLocalAxis[1])), System.Drawing.Color.Red)
            arg.Display.DrawArrow( rg.Line(iLocalAxis[0], rg.Vector3d.Multiply(c,iLocalAxis[2])), System.Drawing.Color.Green)
            arg.Display.DrawArrow( rg.Line(iLocalAxis[0], rg.Vector3d.Multiply(c,iLocalAxis[3])), System.Drawing.Color.Blue)
            
        color = System.Drawing.Color.Azure
        colorWirframe = System.Drawing.Color.Black
        colorMaterial = rc.Display.DisplayMaterial(color, 0.0)
        for iSupport in self.solidSupport :
            arg.Display.DrawBrepShaded( iSupport, colorMaterial)
            arg.Display.DrawBrepWires( iSupport, colorWirframe)
            
        for iLoad in self.viewLoad:
            arg.Display.DrawArrow( rg.Line(iLoad[0], iLoad[1]/self.forceBounds[1]) ,  System.Drawing.Color.DarkRed)
            arg.Display.DrawArrow( rg.Line(iLoad[0], iLoad[2]/self.momentBounds[1]) ,  System.Drawing.Color.DarkBlue)
# ---------- end vm ----------
vbs_2 = ViewBrickStressesAlpaca4d(step=number_slider_12, stressType=number_slider_9)  # -> out, Brick, bounds; inputs step: Int32, stressType: Int32, listColor: list of Color; disabled
# ---------- vbs_2: Python ----------
"""
Read Brick Stresses
-
    Args:
        AlpacaSolvedModel:
        step:
        stressType: 
 <=0: sigma_xx
 1: sigma_yy
 2: sigma_zz
 3: tau_xy
 4: tau_xz
 5: tau_yz
 >=6: sigma_VM (Von Mises criterion)
        listColor : one list of color 
    Returns:
"""

ghenv.Component.Name = "View Brick Stresses (Alpaca4d)"
ghenv.Component.NickName = 'VBS'
ghenv.Component.Message = "View Brick Stresses (Alpaca4d)"

import sys
import os
import System
from System.Drawing import Color


import clr
import clrtype
import Rhino.Geometry as rg
import rhinoscriptsyntax as rs
import Grasshopper as gh
import copy
import ghpythonlib.treehelpers as th
from ghpythonlib.components import Bounds
import math as mt

## add alpaca install directory to system path

ghcompfolder = gh.Folders.DefaultAssemblyFolder
if ghcompfolder not in sys.path:
    sys.path.append(ghcompfolder)

try:
    from Alpaca4d import alpaca4d as alpaca
    from Alpaca4d import alpaca4dView as alpacaView
except:
    msg = "Cannot import Alpaca4d. Is the Alpaca4d folder available in " + ghcompfolder + "?"
    ghenv.Component.AddRuntimeMessage(gh.Kernel.GH_RuntimeMessageLevel.Error, msg)



FolderPath = rs.DocumentPath()
os.chdir(FolderPath)


# import costum modules to read the hdf5 file

my_module_name = "Alpaca_StepReader"
my_module = sys.modules.setdefault(my_module_name, type(sys)(my_module_name))

hdfFilePath = os.path.join(ghcompfolder, "Alpaca4d\HDF5CSharp.dll")
clr.AddReferenceToFileAndPath(hdfFilePath)

from HDF5CSharp import Hdf5

try:
    Steps = my_module.Steps
except AttributeError:
    type_2d = type(System.Array.CreateInstance(float, 1, 1))

    class Steps(object):
        __metaclass__ = clrtype.ClrClass
        _clrfields = {"STEP_{}".format(i): type_2d for i in range(1000)} # it will work for model with less than 1000 steps

    my_module.Steps = Steps

if stressType is None or stressType <0 : stressType = 0
elif stressType >= 6 : stressType = 6

if not listColor: listColor = [ System.Drawing.Color.DarkBlue, 
                                System.Drawing.Color.RoyalBlue, 
                                System.Drawing.Color.CornflowerBlue,
                                System.Drawing.Color.LightSkyBlue, 
                                System.Drawing.Color.LightBlue,
                                System.Drawing.Color.CadetBlue,
                                System.Drawing.Color.White,
                                System.Drawing.Color.Yellow,
                                System.Drawing.Color.Orange,
                                System.Drawing.Color.Red,
                                System.Drawing.Color.DarkRed]

checkData = True

if not AlpacaSolvedModel:
    checkData = False
    msg = "Input parameter AlpacaSolvedModel failed to collect data"
    ghenv.Component.AddRuntimeMessage(gh.Kernel.GH_RuntimeMessageLevel.Warning, msg)

if checkData:
    
    step = (int(AlpacaSolvedModel.analysis.NumberOfSteps) - 1) if step is None else step
# read result
    stress = []
    fileId = Hdf5.OpenFile(AlpacaSolvedModel.recorderName, True)
    
    #asdea shell
    #stressResult = Hdf5.ReadObject[Steps](fileId, "/MODEL_STAGE[1]/RESULTS/ON_ELEMENTS/stresses/203-UnknownMovableObject[201:0:0]/DATA")
    
    #shellMITC4
    stressResult = Hdf5.ReadObject[Steps](fileId, "/MODEL_STAGE[1]/RESULTS/ON_ELEMENTS/stresses/121-UnknownMovableObject[400:0:0]/DATA")
    
    #ShellNLDKGT
    #stressResult = Hdf5.ReadObject[Steps](fileId, "/MODEL_STAGE[1]/RESULTS/ON_ELEMENTS/stresses/167-UnknownMovableObject[103:0:0]/DATA")
    for i,item in enumerate(AlpacaSolvedModel.bricks):
        sigma_xx = getattr(stressResult, 'STEP_{}'.format(step))[i,0]
        sigma_yy = getattr(stressResult, 'STEP_{}'.format(step))[i,1]
        sigma_zz = getattr(stressResult, 'STEP_{}'.format(step))[i,2]
        tau_xy = getattr(stressResult, 'STEP_{}'.format(step))[i,3]
        tau_xz = getattr(stressResult, 'STEP_{}'.format(step))[i,4]
        tau_yz = getattr(stressResult, 'STEP_{}'.format(step))[i,5]
        sigma_VM = mt.sqrt( sigma_xx**2 + sigma_yy**2 + sigma_zz**2  - (sigma_xx*sigma_yy + sigma_yy*sigma_zz + sigma_zz*sigma_yy) + 3*(tau_xy**2 + tau_yz**2 + tau_xz**2))
        stress.append([ sigma_xx, sigma_yy, sigma_zz, tau_xy, tau_xz, tau_yz, sigma_VM ]) #Posso aggiungere VON MISES
        
    Hdf5.CloseFile(fileId)
    print("I have close the file")
    
    ListValor = [ row[stressType] for row in stress ]
    bounds = Bounds(ListValor)
    Brick = alpacaView.ColorBrickStress( AlpacaSolvedModel, ListValor, bounds, listColor)
# ---------- end vbs_2 ----------
data = Data([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])
data_2 = Data(Tree({0}: [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], {0;0}: [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], {0;1}: [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], {0;2}: [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]))
panel_5 = Panel(rf.ReactionForce)  # disabled
number_slider_13 = Slider(12, range=0..100)  # disabled
random = Random(Range=Domain(0, 1), Number=1, Seed=2)  # disabled
gradientlibrary_2 = GradientLibrary(gradIndex=Slider(12, range=0..12))  # -> reverse(colors); inputs gradIndex: Int32; same code as gradientlibrary
dm = DeformedModelAlpaca4d(
    AlpacaSolvedModel=ra.AlpacaSolvedModel,
    step=Slider(1, range=0..10),
    scale=num,
    extrudeModel=Toggle(False),
    typeColor=Slider(4, range=-4..10),
    listColor=gradientlibrary_2)  # -> DefModel, bounds; inputs step: Int32, extrudeModel: Boolean, typeColor: Int32, listColor: list of Color
# ---------- dm: Python ----------
"""View Deformed model
    Args:
        AlpacaSolvedModel: Output of Analyses solver
        step:
        scale: Multiplication factor for displacement
        extrudeModel:  
True : view extruded model
else : view stick model
        typeColor:  View relative color of the traslation
<=0 : view traslation X 
1 : view traslation Y
2 : view traslation Z
>= 3 : view resulting displacement.
        listColor : one list of color 

    Output:
       DefModel: view deformed model
       bounds: max end min of displacement of the structure 
"""

ghenv.Component.Name = "Deformed Model (Alpaca4d)"
ghenv.Component.NickName = 'DM'
ghenv.Component.Message = "Deformed Model (Alpaca4d)"

from ghpythonlib.componentbase import executingcomponent as component
import System
import rhinoscriptsyntax as rs

import sys
import os
import clr
import clrtype
import Rhino.Geometry as rg
import Rhino as rc
import math as mt
import Grasshopper as gh
import ghpythonlib.treehelpers as th
from ghpythonlib.components import ConstructDomain

ghcompfolder = gh.Folders.DefaultAssemblyFolder
if ghcompfolder not in sys.path:
    sys.path.append(ghcompfolder)
try:
    from Alpaca4d import alpaca4dView as alpacaView
except:
    msg = "Cannot import Alpaca4d. Is the Alpaca4d folder available in " + ghcompfolder + "?"
    ghenv.Component.AddRuntimeMessage(gh.Kernel.GH_RuntimeMessageLevel.Error, msg)
    
FolderPath = rs.DocumentPath()
os.chdir(FolderPath)

ghcompfolder = gh.Folders.DefaultAssemblyFolder
my_module_name = "Alpaca_StepReader" # replace this with something unique that doesn't collide with a real module!
my_module = sys.modules.setdefault(my_module_name, type(sys)(my_module_name))

hdfFilePath = os.path.join(ghcompfolder, "Alpaca4d\HDF5CSharp.dll")
clr.AddReferenceToFileAndPath(hdfFilePath)


from HDF5CSharp import Hdf5

class MyComponent(component):
    
    def RunScript(self, AlpacaSolvedModel, step = None, scale = None , extrudeModel = None, typeColor = None, listColor = [] ):
        import sys
        
        self.extrudeModel = extrudeModel
        
        self.defModel1 = []
        self.defModel2 = []
        self.defModel3 = []
        
        self.beamColor = []
        

        if step == None:
            step = 0
        if scale == None:
            scale = 1
        if extrudeModel == None:
            extrudeModel = False
        if typeColor == None:
            typeColor = 3
        
        if not listColor: listColor = [ System.Drawing.Color.DarkViolet, 
                                        System.Drawing.Color.BlueViolet, 
                                        System.Drawing.Color.RoyalBlue, 
                                        System.Drawing.Color.CornflowerBlue,
                                        System.Drawing.Color.LightSkyBlue, 
                                        System.Drawing.Color.LightBlue,
                                        System.Drawing.Color.CadetBlue,
                                        System.Drawing.Color.LightGreen,
                                        System.Drawing.Color.GreenYellow,
                                        System.Drawing.Color.Yellow,
                                        System.Drawing.Color.Orange,
                                        System.Drawing.Color.Red,
                                        System.Drawing.Color.DarkRed]
        
        
        ghcompfolder = gh.Folders.DefaultAssemblyFolder
        if ghcompfolder not in sys.path:
            sys.path.append(ghcompfolder)
    
        try:
            Steps = my_module.Steps
        except AttributeError:
            type_2d = type(System.Array.CreateInstance(float, 1, 1))
                
            class Steps(object):
                __metaclass__ = clrtype.ClrClass
                _clrfields = {"STEP_{}".format(i): type_2d for i in range(1000)} # it will work for model with less than 1000 steps
                
            my_module.Steps = Steps
            
        checkData = True
        
        if not AlpacaSolvedModel:
            checkData = False
            msg = "Input parameter AlpacaSolvedModel failed to collect data"
            ghenv.Component.AddRuntimeMessage(gh.Kernel.GH_RuntimeMessageLevel.Warning, msg)
        else:
            try:
                fileId = Hdf5.OpenFile(AlpacaSolvedModel.recorderName, True)
                numberOfPoints = len(AlpacaSolvedModel.uniquePoints) #
                        
                        
                displacementResult = Hdf5.ReadObject[Steps](fileId, "/MODEL_STAGE[1]/RESULTS/ON_NODES/DISPLACEMENT/DATA")
                displacement = []
                rotation = []
                dispNodeList = []
                for i in range(numberOfPoints):
                    tag = i + 1
                    vx = getattr(displacementResult, 'STEP_{}'.format(step))[i,0]
                    vy = getattr(displacementResult, 'STEP_{}'.format(step))[i,1]
                    vz = getattr(displacementResult, 'STEP_{}'.format(step))[i,2]
                    trasl = rg.Vector3d(vx,vy,vz)
                    displacement.append(trasl)
                    dispNodeList.append( [tag, trasl] )
                    
                Hdf5.CloseFile(fileId)
                print("I have closed the file")
            
                dispNodeDict = dict( dispNodeList )
                #---------------------------------------------------#
                defEleVector1 = alpacaView.BeamVectorDef(AlpacaSolvedModel,dispNodeDict) #beam
                defEleVector2 = alpacaView.ShellVectorDef(AlpacaSolvedModel,dispNodeDict) #shell
                defEleVector3 = alpacaView.BrickVectorDef(AlpacaSolvedModel,dispNodeDict) #shell
                bound = alpacaView.boundsDef(displacement, typeColor)
                if self.extrudeModel == None or self.extrudeModel == False:
                    #BEAM
                    defModel1 = alpacaView.BeamDef(AlpacaSolvedModel, dispNodeDict,scale)
                    self.defModel1, self.beamColor = alpacaView.ColorBeamDef( defModel1, defEleVector1, bound, listColor, typeColor)
                    #SHELL
                    defModel2 = alpacaView.ShellDef(AlpacaSolvedModel,dispNodeDict,scale)
                    #BRICK
                    defModel3 = alpacaView.BrickDef(AlpacaSolvedModel,dispNodeDict,scale)
                else:
                    #BEAM
                    defModel1 = alpacaView.BeamDefExtrude(AlpacaSolvedModel, dispNodeDict,scale)
                    self.defModel1 = alpacaView.ColorBeamDefExtrude( defModel1, defEleVector1, bound, listColor, typeColor)
                    #SHELL
                    defModel2 = alpacaView.ShellDefExtrude(AlpacaSolvedModel,dispNodeDict,scale)
                    #BRICK
                    defModel3 = alpacaView.BrickDef(AlpacaSolvedModel,dispNodeDict,scale)
                    
                #SHELL COLOR
                self.defModel2 = alpacaView.ColorShellDef( defModel2, defEleVector2 , bound, listColor, typeColor, extrudeModel )
                #BRICK COLOR
                self.defModel3 = alpacaView.ColorBrickDef( defModel3, defEleVector3 , bound, listColor, typeColor)
                DefModel = th.list_to_tree(self.defModel1 + defModel2 + defModel3)
                bounds = ConstructDomain(bound[0], bound[1])
                return (DefModel, bounds)
            except:
                Hdf5.CloseFile(fileId)
                print("I have closed the file due to exception")
            # return outputs if you have them; here I try it for you:
        
        
    def DrawViewportWires(self,arg):
        for iMesh in self.defModel2 :
            colorWirframe = System.Drawing.Color.Black
            arg.Display.DrawMeshWires(iMesh, colorWirframe)
            
        for iMesh in self.defModel3 :
            colorWirframe = System.Drawing.Color.Black
            arg.Display.DrawMeshWires(iMesh, colorWirframe)
        if self.extrudeModel is None or self.extrudeModel is False:
            thickness =2
            for iBeam, iColor in zip(self.defModel1, self.beamColor) :
                for jBeam, jColor in zip(iBeam, iColor):
                    arg.Display.DrawCurve(jBeam, jColor, thickness)
        else:
            for iBeam in self.defModel1 :
                colorWirframe = System.Drawing.Color.Black
                arg.Display.DrawMeshWires(iBeam, colorWirframe)
# ---------- end dm ----------
dedomain = DeconstructDomain(Domain=dm.bounds)  # -> Start, End

# ---- group: displacement
data_3 = Data(dedomain.End)

# ----
swatch_2 = ColourSwatch(SwatchColor=RGB(255, 255, 255))  # disabled
toggle_6 = BooleanToggle(True)  # disabled
panel_6 = Panel("0.3")  # disabled
swatch_3 = ColourSwatch(SwatchColor=RGB(0, 0, 0))  # disabled
dom = ConstructDomain(DomainStart=0, DomainEnd=1)  # disabled
toggle_7 = BooleanToggle(True)  # disabled
swatch_4 = ColourSwatch(SwatchColor=RGB(255, 255, 255))  # disabled
swatch_5 = ColourSwatch(SwatchColor=RGB(122, 122, 122))  # disabled
dash = DashPattern(Pattern=panel_6)  # -> Dashes, Gaps; disabled
toggle_8 = BooleanToggle(True)  # disabled

number_slider_14 = Slider(0, range=0..10)  # disabled
swatch_6 = ColourSwatch(SwatchColor=RGB(148, 0, 181))  # disabled
swatch_7 = ColourSwatch(SwatchColor=RGB(255, 170, 0))  # disabled
swatch_8 = ColourSwatch(SwatchColor=RGB(194, 194, 14))  # disabled
swatch_9 = ColourSwatch(SwatchColor=RGB(34, 58, 212))  # disabled
swatch_10 = ColourSwatch(SwatchColor=RGB(48, 159, 255))  # disabled
swatch_11 = ColourSwatch(SwatchColor=RGB(0, 0, 0))  # disabled
swatch_12 = ColourSwatch(SwatchColor=RGB(237, 12, 42))  # disabled
merge_2 = Merge(Data1=swatch_2, Data2=swatch_6, Data3=swatch_7, Data4=swatch_8, Data5=swatch_9, Data6=swatch_10, Data7=swatch_12)  # disabled
item_5 = ListItem(List=merge_2, Index=number_slider_14, Wrap=True)  # disabled
python_9 = GhPythonScript(RhinoColor=item_5, RhinoGrid=toggle_8)  # -> out; inputs RhinoColor: Color, RhinoGrid: Boolean; disabled
# ---------- python_9: Python ----------
import Rhino.ApplicationSettings.AppearanceSettings
import System
import scriptcontext

settings = Rhino.ApplicationSettings.AppearanceSettings
settings.ViewportBackgroundColor = RhinoColor
newViewport  = Rhino.RhinoDoc.ActiveDoc.Views.ActiveView.ActiveViewport
newViewport.ZoomExtents()
#scriptcontext.doc.Views.Redraw()

#print(Rhino.RhinoDoc.ActiveDoc.Views.ActiveView.ActiveViewport.Bounds)
#Turn off grid
newViewport.ConstructionGridVisible = False

#Turn off axes
newViewport.ConstructionAxesVisible = False
# ---------- end python_9 ----------

c_script = CSharpScript(switcher=toggle_7, canvas_back=swatch_4, canvas_grid=swatch_5)  # -> out, A; inputs switcher: Boolean, canvas_back: Color, canvas_grid: Color; disabled
# ---------- c_script: C# ----------
    if (switcher == true)
    {
      Grasshopper.GUI.Canvas.GH_Skin.canvas_grid = canvas_grid;
      Grasshopper.GUI.Canvas.GH_Skin.canvas_back = canvas_back; 
      Grasshopper.GUI.Canvas.GH_Skin.canvas_edge = Color.FromArgb(255, 0, 0, 0); 
      Grasshopper.GUI.Canvas.GH_Skin.canvas_shade = Color.FromArgb(80, 0, 0, 0); 
    }
    else
    {
      //DEFAULTS
      Grasshopper.GUI.Canvas.GH_Skin.canvas_grid = Color.FromArgb(30, 0, 0, 0);
      Grasshopper.GUI.Canvas.GH_Skin.canvas_back = Color.FromArgb(255, 212, 208, 200); 
      Grasshopper.GUI.Canvas.GH_Skin.canvas_edge = Color.FromArgb(255, 0, 0, 0); 
      Grasshopper.GUI.Canvas.GH_Skin.canvas_shade = Color.FromArgb(80, 0, 0, 0);
    }
# ---------- end c_script ----------
cluster = Cluster(col=gradientlibrary_2, C=swatch_3, D=dom, bool=toggle_6)  # disabled

# ----
# Trigonometric Time Series
python_10 = GhPythonScript(tStart=Slider(0, range=0..5), tEnd="10.00", period="3.00")  # -> timeSeries, Graph
# ---------- python_10: Python ----------
"""
Create a PointLoad
-
    Args:
        tStart:
        tEnd:
        period:
        factor:
        shift:
    Returns:
        timeSeries:
        Graph:
"""

import sys
import Rhino.Geometry as rg
import Grasshopper as gh
import copy
import math


## add alpaca install directory to system path

ghcompfolder = gh.Folders.DefaultAssemblyFolder
if ghcompfolder not in sys.path:
    sys.path.append(ghcompfolder)

try:
    from Alpaca4d import alpaca4d as alpaca
except:
    msg = "Cannot import Alpaca4d. Is the Alpaca4d folder available in " + ghcompfolder + "?"
    ghenv.Component.AddRuntimeMessage(gh.Kernel.GH_RuntimeMessageLevel.Error, msg)


def TrigonometricSeries(tStart, tEnd, period, shift, factor,t):
    if tStart <= t and t < tEnd:
        x = factor * math.sin( (2.0 * math.pi * (t - tStart))/period + shift)
        return x
    else:
        return 0

def linspace(a, b, n):
    if n < 2:
        return None
    diff = (float(b) - a)/(n - 1)
    return [diff * i + a  for i in range(n)]



checkData = True

if not tStart and not tStart == 0:
    checkData = False
    msg = "Input parameter tStart failed to collect data"
    ghenv.Component.AddRuntimeMessage(gh.Kernel.GH_RuntimeMessageLevel.Warning, msg)

if not tEnd and not tEnd == 0:
    checkData = False
    msg = "Input parameter tEnd failed to collect data"
    ghenv.Component.AddRuntimeMessage(gh.Kernel.GH_RuntimeMessageLevel.Warning, msg)

if not period:
    checkData = False
    msg = "Input parameter period failed to collect data"
    ghenv.Component.AddRuntimeMessage(gh.Kernel.GH_RuntimeMessageLevel.Warning, msg)

if not factor:
    factor = 1

if not shift:
    shift = 0

if checkData:
    timeSeries = alpaca.TimeSeriesTrigonometric(tStart, tEnd, period, factor, shift)

    Graph = []
    
    for t in linspace(0,tEnd*2,100):
        Graph.append(TrigonometricSeries(tStart, tEnd, period, shift, factor,t))
# ---------- end python_10 ----------
panel_7 = Panel(python_10.timeSeries)

graph_2 = QuickGraph(python_10.Graph, SortOrder=0)

num_2 = Number([-0.000450671, -0.000455154, -1.48413e-05, 0.000507632, 0.000437923, 0.000441503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])
lng_2 = ListLength(List=num_2)
series = Series(Start=0, Step="0.01", Count=lng_2)

# ----
# Path TimeSeries
number_slider_15 = Slider(7, range=1..10)
python_11 = GhPythonScript(time=series, values=num_2, factor=number_slider_15)  # -> out, timeSeries, Graph; inputs time: list, values: list
# ---------- python_11: Python ----------
"""
Create a Time Series Path
-
    Args:
        time:
        values:
        factor:
    Returns:
        timeSeries:
        Graph:
"""

import sys
import Rhino.Geometry as rg
import Grasshopper as gh
import copy


## add alpaca install directory to system path

ghcompfolder = gh.Folders.DefaultAssemblyFolder
if ghcompfolder not in sys.path:
    sys.path.append(ghcompfolder)

try:
    from Alpaca4d import alpaca4d as alpaca
except:
    msg = "Cannot import Alpaca4d. Is the Alpaca4d folder available in " + ghcompfolder + "?"
    ghenv.Component.AddRuntimeMessage(gh.Kernel.GH_RuntimeMessageLevel.Error, msg)


checkData = True

if not time:
    checkData = False
    msg = "Input parameter time failed to collect data"
    ghenv.Component.AddRuntimeMessage(gh.Kernel.GH_RuntimeMessageLevel.Warning, msg)

if not values:
    checkData = False
    msg = "Input parameter values failed to collect data"
    ghenv.Component.AddRuntimeMessage(gh.Kernel.GH_RuntimeMessageLevel.Warning, msg)

if not factor:
    factor = 1


if checkData:
    timeSeries = alpaca.TimeSeriesPath(values, time, factor)
    Graph = [value * factor for value in values]
# ---------- end python_11 ----------

graph_3 = QuickGraph(python_11.Graph, SortOrder=0)

# ==== cluster Cluster
bool = ClusterInput()
C = ClusterInput()
col = ClusterInput()
D = ClusterInput()

python = GhPythonScript()  # -> out, ViewWidth, ViewHeight, scale
# ---------- python: Python ----------
import Rhino.ApplicationSettings.AppearanceSettings
import System
import scriptcontext

newViewport  = Rhino.RhinoDoc.ActiveDoc.Views.ActiveView.ActiveViewport
newViewport.ZoomExtents()
#Turn off grid
H = newViewport.Bounds.Height 
ViewHeight = H*(1 - 0.1)
W = newViewport.Bounds.Width
ViewWidth = W*(1 - 0.19)
scale = ViewWidth*(1 - 0.96)

scriptcontext.doc.Views.Redraw()
# ---------- end python ----------
python_2 = GhPythonScript(listColor=col, c="10")  # -> out, gradient_Mesh; inputs listColor: list of Color, c: Int32
# ---------- python_2: Python ----------
__author__ = "Domen"
__version__ = "2021.04.17"

import rhinoscriptsyntax as rs
import Rhino.Geometry as rg

if c is not None: c = 10

gradient_Mesh = rg.Mesh()
if listColor is not None:
    s = c/(len(listColor)-1)
    for i in range(len(listColor)):
        gradient_Mesh.Vertices.Add( rg.Point3d(i*s, 0, 0 ) )
        gradient_Mesh.Vertices.Add( rg.Point3d(i*s, 0.5, 0 ) )
        gradient_Mesh.VertexColors.Add( listColor[i] )
        gradient_Mesh.VertexColors.Add( listColor[i] )
        
    nF = len(listColor) -1
    for i in range(nF):
        gradient_Mesh.Faces.AddFace( i*2, i*2+1, i*2+3, i*2+2 )
# ---------- end python_2 ----------

multiplication = Multiplication(A=python.scale, B="0.15")
multiplication_2 = Multiplication(A=python.scale, B="10")
pt = ConstructPoint(XCoordinate=python.ViewWidth, YCoordinate=python.ViewHeight, ZCoordinate=0)
medges = MeshEdges(Mesh=python_2.gradient_Mesh)  # -> NakedEdges, InteriorEdges, NonManifoldEdges
division = Division(A=multiplication_2, B="2")
X = UnitX(Factor=division)
rev = Reverse(Vector=X)
move = Move(Geometry=pt, Motion=rev)  # -> Geometry, Transform
multiplication_3 = Multiplication(A=python.scale, B="10")
X_2 = UnitX(Factor=multiplication_3)
col_2 = Colour(col)
move_2 = Move(Geometry=move.Geometry, Motion=X_2)  # -> Geometry, Transform
lng = ListLength(List=col_2)
dist = Distance(PointA=move.Geometry, PointB=move_2.Geometry)
data = Data(flatten(Tree({0;0}: [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], {0;1}: [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], {0;2}: [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], {0;3}: [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], {0;4}: [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], {0;5}: [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]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)))
range = Range(Domain=D, Steps=lng)  # -> expr("Round(x,2)", Range)
range_2 = Range(Domain=dist, Steps=lng)
division_2 = Division(A=python.scale, B="2.5")
python_3 = GhPythonScript(AlpacaLogo=data, bool=bool)  # -> out, curve; inputs AlpacaLogo: Curve, bool: Boolean
# ---------- python_3: Python ----------
__author__ = "Domen"
__version__ = "2021.04.17"


if bool is False:
    curve = None
else :
    curve = AlpacaLogo
# ---------- end python_3 ----------
python_4 = GhPythonScript()  # -> out, ViewWidth, ViewHeight, scale
# ---------- python_4: Python ----------
import Rhino.ApplicationSettings.AppearanceSettings
import System
import scriptcontext


H = Rhino.RhinoDoc.ActiveDoc.Views.ActiveView.ActiveViewport.Bounds.Height 
ViewHeight = H*()
W = Rhino.RhinoDoc.ActiveDoc.Views.ActiveView.ActiveViewport.Bounds.Width
ViewWidth = W*()
#scale = 5 #ViewWidth*(1 - )
print(scale)

scale = 6
newViewport  = Rhino.RhinoDoc.ActiveDoc.Views.ActiveView.ActiveViewport
newViewport.ZoomExtents()
#Turn off grid
H = newViewport.Bounds.Height 
ViewHeight = H*(1 -(scale/2*0.3))
W = newViewport.Bounds.Width
ViewWidth = W*(1 -(scale/2*0.1))

scriptcontext.doc.Views.Redraw()
# ---------- end python_4 ----------
vec = VectorXYZ(XComponent=range_2, YComponent=division_2, ZComponent=0)  # -> Vector, Length
addition = Addition(A=move.Geometry, B=vec.Vector)
vec_2 = VectorXYZ(XComponent=multiplication, YComponent=0, ZComponent=0)  # -> Vector, Length
multiplication_4 = Multiplication(A=python_4.scale)
division_3 = Division(A=multiplication_4, B="2")
pt_2 = ConstructPoint(XCoordinate=python_4.ViewWidth, YCoordinate=python_4.ViewHeight, ZCoordinate=0)
subtraction = Subtraction(A=addition, B=vec_2.Vector)
X_3 = UnitX(Factor=division_3)
rev_2 = Reverse(Vector=X_3)
move_3 = Move(Geometry=pt_2, Motion=rev_2)  # -> Geometry, Transform
crvtoscreen = RenderCurveToScreen(
    Curve=[medges.NakedEdges, medges.InteriorEdges],
    Location=move.Geometry,
    ScaleFactor=python.scale,
    Color=C,
    Thickness=1,
    Depth=0.95,
    Fixed=True,
    m_scWithvp=False)
meshtoscreen = RenderMeshToScreen(Mesh=python_2.gradient_Mesh, Location=move.Geometry, ScaleFactor=python.scale, Depth=0.95, Fixed=True, m_scWithvp=False)
texttoscreen = RenderTextToScreen(Text=range, Location=subtraction, Size=multiplication, Color=C, Font="Iosevka", m_scWithvp=False)
crvtoscreen_2 = RenderCurveToScreen(
    Curve=python_3.curve,
    Location=move_3.Geometry,
    ScaleFactor=python_4.scale,
    Color=ColourSwatch(SwatchColor=RGB(10, 5, 5)),
    Thickness=1,
    Depth=0.95,
    Fixed=True,
    m_scWithvp=False)
