# Grasshopper definition GrasshopperCluster.gh (Grasshopper 1.0.7)
# plug-ins: Human

# ---- group: Element
data = Data(0)
data_2 = Data(0)

# ---- group: Load
data_3 = Data(0)
data_4 = Data(0)

# ---- group: Cross-Section
data_5 = Data(0)
data_6 = Data(0)

# ---- group: Support
data_7 = Data(0)
data_8 = Data(0)

# ---- group: Constraint
data_9 = Data(0)
data_10 = Data(0)

# ---- group: Material
data_11 = Data(0)
data_12 = Data(0)

# ---- group: Assemble
# Pre - Processing
panel = Panel("35")
panel_2 = Panel("35")
panel_3 = Panel("75")
panel_4 = Panel("75")
panel_5 = Panel("80760")
panel_6 = Panel("80760")
panel_7 = Panel("210000")
panel_8 = Panel("210000")
panel_9 = Panel("S275")
panel_10 = Panel("S275")
panel_11 = Panel("100")
panel_12 = Panel("500")
# Model 4
# Model 5
panel_13 = Panel("20")
panel_14 = Panel("600")
panel_15 = Panel("Generic")
panel_16 = Panel("300")
panel_17 = Panel("40")
panel_18 = Panel("25")
panel_19 = Panel("300")
panel_20 = Panel("700")
panel_21 = Panel("400")
panel_22 = Panel("300")
panel_23 = Panel("TT")
panel_24 = Panel("concreteSlab")
panel_25 = Panel("RHS")
panel_26 = Panel("RHS")
panel_27 = Panel("CHS")
list = ValueList({"Truss": 0, "Beam": 1}, selected="Beam")
panel_28 = Panel("0")
toggle = BooleanToggle(True)
toggle_2 = BooleanToggle(True)
assemble = Assemble()  # -> alpacamodel_2, alpacamodel, massofstructure
point = Point()
value_list = ValueList({"LocalAxis": 0, "GlobalAxis": 1}, selected="GlobalAxis")
point_2 = Point()
vector = Vector(expr("x*0", Vector(2.518385542, -6.656153768, 0)))
crv = Curve(<curve referenced from the Rhino model>)
num = Number()
pt = Point()
vector_2 = Vector()
vector_3 = Vector()

# ---- group: Assemble / material
uniaxialmaterialelastic = UniaxialMaterialElastic(matname=panel_9, E=panel_7, G=panel_5, rho=panel_3, fy=panel)
ndmaterialelasticisotropic = NDMaterialElasticIsotropic(matname=panel_10, E=panel_8, G=panel_6, rho=panel_4, fy=panel_2)

# ---- group: Assemble / Cross-Section
rectangularhollowcrosssection = RectangularHollowCrossSection(sectionname=panel_26, base=panel_22, height=panel_22, thickness=panel_18)
rectangularcrosssection = RectangularCrossSection(sectionname=panel_25, base=panel_19, height=panel_19)
elasticmembraneplatesection = ElasticMembranePlateSection(sectionname=panel_24, thickness=panel_20)
circularcrosssection = CircularCrossSection(sectionname=panel_27, diameter=panel_21, thickness=panel_17)
genericcrosssection = GenericCrossSection(
    sectionname=panel_15,
    area=panel_13,
    ay=panel_13,
    az=panel_13,
    iyy=panel_13,
    izz=panel_13,
    J=panel_13,
    uniaxialmaterial=panel_13)
doubletcrosssection = DoubleTCrossSection(sectionname=panel_23, bsup=panel_16, binf=panel_14, H=panel_12, tsup=panel_11, tinf=panel_11, tw=panel_11)

# ---- group: Assemble / Element
meshtoshell = MeshToshell()
linetobeam = LineToBeam(orientsection=panel_28, beamtype=list)
solid = Solid()

# ---- group: Assemble / support
support = Support(pos=point, tx=toggle_2, ty=toggle_2, tz=toggle_2, rx=toggle, ry=toggle, rz=toggle)

# ---- group: Assemble / Load
linearload = LinearLoad(force=vector_2, element=crv, orientation=value_list)
pointload = PointLoad(force=vector_3, moment=vector, pos=point_2)
massload = MassLoad(nodalmass=num, pos=pt)

# ---- group: model
disassemblemodel = DisassembleModel()  # -> modelview, modelviewextruded, points, support, load, material, section
modelview = ModelView(modelexstrud=Toggle(True))

# ---- group: displacement Component
# numerical output
number_slider = Slider(7, range=0..10)
number_of_line_to_skip = Slider(90, range=1..100)
list_2 = ValueList({"tx": 0, "ty": 1, "tz": 2}, selected="ty")
list_3 = ValueList({"tx": 0, "ty": 1, "tz": 2}, selected="tx")
list_4 = ValueList({"tx": 0, "ty": 1, "tz": 2}, selected="tx")
brick_displacement = BrickDisplacement()  # -> out, tagelement, trans
shell_displacement = ShellDisplacement()  # -> tagelement, trans, rot
beam_displacement = BeamDisplacement(numberresults=Slider(10, range=0..10))  # -> tagelement, localtrans, localrot, globaltrans, globalrot
deformedmodelview = DeformedModelView(direction=list_3, scale=Slider(2764, range=0..10000), modelexstrud=Toggle(False))  # -> modeldisp, max_min
nodedisp = NodeDisp()  # -> points, trans, rot
groundmotion_view = GroundMotionView(
    speed=number_of_line_to_skip,
    animate=Toggle(False),
    reset=Button(),
    scale=Slider(25, range=0..1000),
    direction=list_2,
    modelexstrud=Toggle(True))  # -> modeldisp, trans, rot
modal_animate = ModalAnimate(
    numbermode=Slider(2, range=0..10),
    speed=Slider(1, range=1..50),
    animate=Toggle(False),
    reset=Button(),
    scale=number_slider,
    direction=list_4,
    modelexstrud=Toggle(True))  # -> modeldisp, max_min

# ---- group: Reaction Forces
reaction = Reaction(reactionforcesview=Toggle(True), reactionmomentsview=Toggle(True), scale=Slider(10, range=0..100))  # -> tagpoints, reactionforce, reactionmoment

# ---- group: Cds Visualisation
# shell Component
list_5 = ValueList({"N": 0, "V1": 1, "V2": 2, "M2": 3, "M1": 4, "Mt": 5}, selected="N")
forcesview = ForcesView(cds=list_5, scale=Slider(0.675, range=0.001..10))

# ---- group: shell Force Visualisation
list_6 = ValueList({"8Color": 0, "20Color": 1}, selected="8Color")
list_7 = ValueList({"Fx": 0, "Fy": 1, "Fz": 2, "Mx": 3, "My": 4, "Mz": 5}, selected="Fx")
shellforcesview = ShellForcesView(viewforce=list_7, ncolor=list_6)  # -> mesh, positive_2, positive

# ---- group: Beam Forces
# beam Component
number_slider_2 = Slider(10, range=0..10)
beamforces = BeamForces(numberresults=number_slider_2)  # -> tagelement, N, v1, v2, mt, m1, m2

# ---- group: Shell Stress Visualisation
list_8 = ValueList({"8Color": 0, "20Color": 1}, selected="8Color")
list_9 = ValueList({"pxx": 0, "pyy": 1, "pxy": 2, "txz": 3, "tyz": 4, "mxx": 5, "myy": 6, "mxy": 7}, selected="pxx")
shellstressview = ShellStressView(stressview=list_9, ncolor=list_8)  # -> mesh, color, tag, stressvalue, domain

# ----
# Brick component
list_10 = ValueList({"sigmaX": 0, "sigmaY": 1, "sigmaZ": 2, "tauXY": 3, "tauXZ": 4, "tauYZ": 5}, selected="tauYZ")
list_11 = ValueList({"8Color": 0, "20Color": 1}, selected="20Color")

# ---- group: shell Forces
shellforcesvalue = ShellForcesValue()  # -> tagelement, fx, fy, fz, mx, my, mz

# ---- group: nD Stress Visualisation
brickstressview = BrickStressView(stressview=list_10, ncolor=list_11)  # -> mesh, color, stressvalue, tag, domain

# ---- group: Legend Display
number_slider_3 = Slider(10, range=0..10)  # disabled
number_slider_4 = Slider(35, range=0..1000)  # disabled
number_slider_5 = Slider(655, range=0..1000)  # disabled

# ----
# Post - Processing
path = FilePath("C:\GitHub\Alpaca4d\PythonScript\Analyses\EarthQuakeAnalysis\BM68elc.acc")
list_12 = ValueList({"x": 1, "y": 2, "z": 3}, selected="y")
list_item = ListItem(List=modal_animate.max_min, Index=0, Wrap=True)  # -> Item, Item1
construct_domain = ConstructDomain(DomainStart=list_item.Item1, DomainEnd=list_item.Item)  # disabled
dedomain = DeconstructDomain(Domain=construct_domain)  # -> Start, End; disabled
ghpython_script = GhPythonScript(max=dedomain.End, min=dedomain.Start)  # -> out, color, tag, domain; disabled
# ---------- ghpython_script: Python ----------
import Rhino.Geometry as rg
import ghpythonlib.components as ghcomp
import math as mt
import ghpythonlib.treehelpers as th # per data tree
import Grasshopper
#import System as sy #DV
import sys
import rhinoscriptsyntax as rs

'''
ghFilePath = ghenv.LocalScope.ghdoc.Path
ghFileName = ghenv.LocalScope.ghdoc.Name
folderNameLength = len(ghFilePath)-len(ghFileName)-2 #have to remove '.gh'
ghFolderPath = ghFilePath[0:folderNameLength]

outputPath = ghFolderPath + 'assembleData'
wrapperFile = ghFolderPath + 'assembleData\\openSeesModel.txt'

userObjectFolder = Grasshopper.Folders.DefaultUserObjectFolder
fileName = userObjectFolder + 'Alpaca'
'''
fileName = r'C:\GitHub\Alpaca4d\PythonScript\function'
sys.path.append(fileName)

def gradientJet2(value, valueMax, valueMin):

    listcolo = [ rs.CreateColor( 0, 0, 102 ),
                rs.CreateColor( 0, 0, 255 ),
                rs.CreateColor( 0, 64, 255 ),
                rs.CreateColor( 0, 128, 255 ),
                rs.CreateColor( 0, 191, 255 ),
                rs.CreateColor( 0, 255, 255 ),
                rs.CreateColor( 0, 255, 191 ),
                rs.CreateColor( 0, 255, 128 ),
                rs.CreateColor( 0, 255, 64 ),
                rs.CreateColor( 0, 255, 0 ),
                rs.CreateColor( 64, 255, 0 ),
                rs.CreateColor( 128, 255, 0 ),
                rs.CreateColor( 191, 255, 0 ),
                rs.CreateColor( 255, 255, 0 ),
                rs.CreateColor( 255, 191, 0 ),
                rs.CreateColor( 255, 128, 0 ),
                rs.CreateColor( 255, 64, 0 ),
                rs.CreateColor( 255, 0, 0 ),
                rs.CreateColor( 230, 0, 0 ),
                rs.CreateColor( 204, 0, 0 )]

    #domain = linspace( valueMin,  valueMax, len( listcolo ) )
    n = len( listcolo )
    diff = (float(valueMax) - valueMin)/( n - 1 )
    domain = [diff * i + valueMin  for i in range(n)]
    return [ listcolo, domain ]


colorList = gradientJet2( value, max, min )
color = colorList[0]  #.reverse()
color.reverse()
tag = []
tag.append( str(round(colorList[1][0],2) ) )
for i in range(1,len(colorList[1])):
    tag.append( str(round(colorList[1][i-1],2)) + '< valor < ' + str(round(colorList[1][i],2)) )
domain = colorList[1]
tag.reverse()
# ---------- end ghpython_script ----------
number_slider_6 = Slider(40, range=0..100)  # disabled
number_slider_7 = Slider(2, range=0..10)  # disabled
lng = ListLength(List=ghpython_script.domain)  # disabled
planesrf = PlaneSurface(Plane=PlaneXY(0, 0, 0), XSize=number_slider_6, YSize=number_slider_7)  # disabled
divide = DivideDomain²(Domain=planesrf, UCount=lng, VCount=1)  # disabled
subsrf = Isotrim(Surface=planesrf, Domain=divide)  # disabled
mcol = MeshColours(Mesh=graft(subsrf), Colours=graft(ghpython_script.color))  # disabled
mjoin = MeshJoin(Meshes=flatten(mcol))  # disabled
pt_2 = ConstructPoint(XCoordinate=number_slider_5, YCoordinate=number_slider_4, ZCoordinate=0)  # disabled
M = Mesh(mjoin)  # disabled
render_mesh_to_screen = RenderMeshToScreen(Mesh=mjoin, Location=pt_2, ScaleFactor=number_slider_3, Depth=0.95, Fixed=True, m_scWithvp=False)  # disabled

file = ReadFile(File=path, PerLineParse=False)
split = TextSplit(Text=file, Separators=" ")
division = Division(A=split, B="1")
clean = CleanTree(RemoveNulls=True, RemoveInvalid=True, RemoveEmpty=invert(False), Tree=division)
lng_2 = ListLength(List=clean)
multiplication = Multiplication(A=lng_2, B="0.01")
graph = QuickGraph(clean, SortOrder=0)
earthquake_file_seconds = Panel(multiplication)

series = Series(Start=0, Step="0.01", Count=lng_2)

# ---- group: Analyses
groundmotionanalyses = GroundMotionAnalyses(
    groundmotiondirection=list_12,
    groundmotionvalues=series,
    groundmotiontimestep="2",
    groundmotionfactor="1",
    timestepincrement="0.005",
    damping=0.02,
    newmarkgamma=0.5,
    newmarkbeta=0.25)  # -> alpacagroundmotionoutput, maxdisplacement, mindisplacement
modalanalyses = ModalAnalyses()  # -> alpacamodaloutput, frequency, period
solverstaticanalyses = SolverStaticAnalyses()

# ==== cluster MeshToshell

# ----
# meshToShell
meshtoshell = ClusterInput()
colour = ClusterInput()
file_path = FilePath("C:\GitHub\Alpaca4d\PythonScript\Pre-Processing\Element\MeshToShell\MeshToShell.py")
mesh = ClusterInput()
read_file = ReadFile(File=file_path, PerLineParse=False)
python = GhPythonScript(Code=read_file, Mesh=mesh, Colour=colour, CrossSection=meshtoshell)  # -> Out, flatten(ShellWrapper)

shellwrapper = ClusterOutput(python.ShellWrapper)

# ==== cluster LineToBeam
beamtype = ClusterInput()
orientsection = ClusterInput()
crosssection = ClusterInput()
file_path = FilePath("C:\GitHub\Alpaca4d\PythonScript\Pre-Processing\Element\LineToBeam\LineToBeam.py")
colour = ClusterInput()
read_file = ReadFile(File=file_path, PerLineParse=False)
line = ClusterInput()
# LineToBeam
python = GhPythonScript(Code=read_file, Line=line, Colour=colour, CrossSection=crosssection, OrientSection=orientsection, BeamType=beamtype)  # -> Out, flatten(BeamWrapper)
beamwrapper = ClusterOutput(python.BeamWrapper)

# ==== cluster Solid
ndmaterial = ClusterInput()
file_path = FilePath("C:\GitHub\Alpaca4d\PythonScript\Pre-Processing\Element\Brick\BbarBrick.py")
colour = ClusterInput()
read_file = ReadFile(File=file_path, PerLineParse=False)
brick = ClusterInput()

# ----
# Solid
python = GhPythonScript(Code=read_file, Brick=brick, Colour=colour, NDMaterial=ndmaterial)  # -> Out, flatten(SolidWrapper)

solidwrapper = ClusterOutput(python.SolidWrapper)

# ==== cluster ElasticMembranePlateSection

# ----
# Elastic Membrane Plate Section
ndmaterial = ClusterInput()
file_path = FilePath("C:\GitHub\Alpaca4d\PythonScript\Pre-Processing\Section\ElasticMembranePlateSection.py")
thickness = ClusterInput()
read_file = ReadFile(File=file_path, PerLineParse=False)
sectionname = ClusterInput()
python = GhPythonScript(Code=read_file, SectionName=sectionname, Thickness=thickness, NDMaterial=ndmaterial)  # -> Out, CrossSection
crosssection = ClusterOutput(python.CrossSection)

# ==== cluster RectangularCrossSection
uniaxialmaterial = ClusterInput()
height = ClusterInput()
base = ClusterInput()
file_path = FilePath("C:\GitHub\Alpaca4d\PythonScript\Pre-Processing\Section\RectangularCrossSection.py")
sectionname = ClusterInput()
read_file = ReadFile(File=file_path, PerLineParse=False)
python = GhPythonScript(Code=read_file, SectionName=sectionname, Base=base, Height=height, UniaxialMaterial=uniaxialmaterial)  # -> Out, CrossSection
crosssection = ClusterOutput(python.CrossSection)

# ==== cluster RectangularHollowCrossSection

# ---- group: Rectangular Hollow Cross Section
uniaxialmaterial = ClusterInput()
thickness = ClusterInput()
height = ClusterInput()
file_path = FilePath("C:\GitHub\Alpaca4d\PythonScript\Pre-Processing\Section\RectangularHollowCrossSection.py")
base = ClusterInput()
read_file = ReadFile(File=file_path, PerLineParse=False)
sectionname = ClusterInput()
python = GhPythonScript(
    Code=read_file,
    SectionName=sectionname,
    Base=base,
    Height=height,
    Thickness=thickness,
    UniaxialMaterial=uniaxialmaterial)  # -> Out, CrossSection
crosssection = ClusterOutput(python.CrossSection)

# ==== cluster CircularCrossSection

uniaxialmaterial = ClusterInput()
thickness = ClusterInput()
diameter = ClusterInput()
file_path = FilePath("C:\GitHub\Alpaca4d\PythonScript\Pre-Processing\Section\CircularCrossSection.py")
sectionname = ClusterInput()
read_file = ReadFile(File=file_path, PerLineParse=False)
python = GhPythonScript(Code=read_file, SectionName=sectionname, Diameter=diameter, Thickness=thickness, UniaxialMaterial=uniaxialmaterial)  # -> Out, CrossSection
crosssection = ClusterOutput(python.CrossSection)

# ==== cluster DoubleTCrossSection

uniaxialmaterial = ClusterInput()
tw = ClusterInput()
tinf = ClusterInput()
tsup = ClusterInput()
H = ClusterInput()
binf = ClusterInput()
file_path = FilePath("C:\GitHub\Alpaca4d\PythonScript\Pre-Processing\Section\doubleTCrossSection.py")
bsup = ClusterInput()
read_file = ReadFile(File=file_path, PerLineParse=False)
sectionname = ClusterInput()
python = GhPythonScript(
    Code=read_file,
    SectionName=sectionname,
    Bsup=bsup,
    Binf=binf,
    H=H,
    Tsup=tsup,
    Tinf=tinf,
    Tw=tw,
    UniaxialMaterial=uniaxialmaterial)  # -> Out, CrossSection
crosssection = ClusterOutput(python.CrossSection)

# ==== cluster UniaxialMaterialElastic
fy = ClusterInput()
rho = ClusterInput()
file_path = FilePath("C:\GitHub\Alpaca4d\PythonScript\Pre-Processing\Material\uniAxialMaterial\ElasticUniaxialMaterial.py")
G = ClusterInput()
read_file = ReadFile(File=file_path, PerLineParse=False)
E = ClusterInput()
matname = ClusterInput()
python = GhPythonScript(Code=read_file, MatName=matname, E=E, G=G, Rho=rho, Fy=fy)  # -> Out, UniaxialMaterial
uniaxialmaterial = ClusterOutput(python.UniaxialMaterial)

# ==== cluster GenericCrossSection
uniaxialmaterial = ClusterInput()
J = ClusterInput()
izz = ClusterInput()
iyy = ClusterInput()
az = ClusterInput()
file_path = FilePath("C:\GitHub\Alpaca4d\PythonScript\Pre-Processing\Section\GenericCrossSection.py")
ay = ClusterInput()
area = ClusterInput()
read_file = ReadFile(File=file_path, PerLineParse=False)
sectionname = ClusterInput()
python = GhPythonScript(
    Code=read_file,
    SectionName=sectionname,
    Area=area,
    Ay=ay,
    Az=az,
    Iyy=iyy,
    Izz=izz,
    J=J,
    UniaxialMaterial=uniaxialmaterial)  # -> Out, CrossSection
crosssection = ClusterOutput(python.CrossSection)

# ==== cluster NDMaterialElasticIsotropic
fy = ClusterInput()
rho = ClusterInput()
v = ClusterInput()
G = ClusterInput()
E = ClusterInput()
matname = ClusterInput()

file_path = FilePath("C:\GitHub\Alpaca4d\PythonScript\Pre-Processing\Material\nDMaterial\ElasticIsotropic.py")
read_file = ReadFile(File=file_path, PerLineParse=False)
python = GhPythonScript(Code=read_file, MatName=matname, E=E, G=G, V=v, Rho=rho, Fy=fy)  # -> Out, NDMaterial

ndmaterial = ClusterOutput(python.NDMaterial)

# ==== cluster Support
rz = ClusterInput()
ry = ClusterInput()
rx = ClusterInput()
file_path = FilePath("C:\GitHub\Alpaca4d\PythonScript\Pre-Processing\Element\Support\Support.py")
tz = ClusterInput()
read_file = ReadFile(File=file_path, PerLineParse=False)
ty = ClusterInput()
tx = ClusterInput()
pos = ClusterInput()
python = GhPythonScript(Code=read_file, Pos=graft(pos), Tx=tx, Ty=ty, Tz=tz, Rx=rx, Ry=ry, Rz=rz)  # -> Out, flatten(SupportWrapper)
supportwrapper = ClusterOutput(python.SupportWrapper)

# ==== cluster PointLoad
file_path = FilePath("C:\GitHub\Alpaca4d\PythonScript\Pre-Processing\Load\PointLoad.py")
pos = ClusterInput()
read_file = ReadFile(File=file_path, PerLineParse=False)
moment = ClusterInput()
force = ClusterInput()
python = GhPythonScript(Code=read_file, Force=force, Moment=moment, Pos=pos)  # -> Out, flatten(LoadWrapper)
loadwrapper = ClusterOutput(python.LoadWrapper)

# ==== cluster LinearLoad
orientation = ClusterInput()
file_path = FilePath("C:\GitHub\Alpaca4d\PythonScript\Pre-Processing\Load\BeamLoad.py")
element = ClusterInput()
read_file = ReadFile(File=file_path, PerLineParse=False)
force = ClusterInput()
python = GhPythonScript(Code=read_file, Force=force, Element=element, Orientation=orientation)  # -> Out, flatten(BeamUniformLoad)
beamuniformload = ClusterOutput(python.BeamUniformLoad)

# ==== cluster MassLoad

pos = ClusterInput()
path = FilePath("C:\GitHub\Alpaca4d\PythonScript\Pre-Processing\Load\MassLoad.py")
nodalmass = ClusterInput()
file = ReadFile(File=path, PerLineParse=False)
python = GhPythonScript(Code=file, NodalMass=nodalmass, Pos=pos)  # -> Out, flatten(Mass)
mass = ClusterOutput(python.Mass)

# ==== cluster Assemble

mass = ClusterInput()
load = ClusterInput()
file_path = FilePath("C:\GitHub\Alpaca4d\PythonScript\Pre-Processing\Assemble\Assemble.py")
support = ClusterInput()
read_file = ReadFile(File=file_path, PerLineParse=False)
element = ClusterInput()
python = GhPythonScript(Code=read_file, Element=flatten(element), Support=flatten(support), Load=flatten(load), Mass=flatten(mass))  # -> Out, AlpacaModel, MassOfStructure
alpacamodel = ClusterOutput(python.AlpacaModel)
massofstructure = ClusterOutput(python.MassOfStructure)

alpacamodel_2 = ClusterOutput(python.AlpacaModel)

# ==== cluster ModelView
nodalmass = ClusterInput()
elementtag = ClusterInput()
nodetag = ClusterInput()
localaxes = ClusterInput()
support = ClusterInput()
load = ClusterInput()
modelexstrud = ClusterInput()
alpacamodel = ClusterInput()

file_path = FilePath("C:\GitHub\Alpaca4d\PythonScript\Post-Processing\modelView\modelView.py")
read_file = ReadFile(File=file_path, PerLineParse=False)
python = GhPythonScript(
    Code=read_file,
    AlpacaModel=alpacamodel,
    ModelExstrud=modelexstrud,
    Load=load,
    Support=support,
    LocalAxes=localaxes,
    NodeTag=nodetag,
    ElementTag=elementtag,
    NodalMass=nodalmass)  # -> ModelView, LineModel, ForceDisplay, Support, LocalAxis, TagNode, TagEle, Mass
explode_tree = ExplodeTree(Data=python.LocalAxis)  # -> Branch0, Branch1, Branch2, Branch3
explode_tree_2 = ExplodeTree(Data=python.LineModel)  # -> Branch0, Branch1
explode_tree_3 = ExplodeTree(Data=simplify(python.TagNode))  # -> Branch0, Branch1
explode_tree_4 = ExplodeTree(Data=simplify(python.TagEle))  # -> Branch0, Branch1
explode_tree_5 = ExplodeTree(Data=simplify(python.Mass))  # -> Branch0, Branch1
explode_tree_6 = ExplodeTree(Data=python.ForceDisplay)  # -> Branch0, Branch1
curve_direction = GhPythonScript(Crv=explode_tree_2.Branch0, Thickness=Slider(3, range=0..10), RGB=explode_tree_2.Branch1)  # -> out; inputs Crv: list of Curve, RGB: list of Color
# ---------- curve_direction: Python ----------
from ghpythonlib.componentbase import executingcomponent as component
import Grasshopper, GhPython
import System
import Rhino as rh
import rhinoscriptsyntax as rs
import Rhino.Geometry as rg


class CurveColor(component):

    def RunScript(self,Crv,Thickness,RGB):
        self.C = Crv
        self.RGB = RGB
        self.t = Thickness
        if not self.C: return
            
    def DrawViewportWires(self,arg):
        if not  self.C: return
        for curve, color in zip( self.C, self.RGB ):
            arg.Display.DrawCurve(curve, color,self.t)
# ---------- end curve_direction ----------
modelview = ClusterOutput(python.ModelView)
custom_preview = CustomPreview(Geometry=python.Support, Material=ColourSwatch(SwatchColor=RGB(164, 252, 0)))
vector_display_ex = VectorDisplayEx(Point=explode_tree_6.Branch0, Vector=explode_tree_6.Branch1, Colour=ColourSwatch(SwatchColor=RGB(176, 32, 32)), Width=2)
vector_display_ex_2 = VectorDisplayEx(Point=explode_tree.Branch0, Vector=explode_tree.Branch1, Colour=ColourSwatch(SwatchColor=RGB(252, 0, 0)), Width=2)
vector_display_ex_3 = VectorDisplayEx(Point=explode_tree.Branch0, Vector=explode_tree.Branch2, Colour=ColourSwatch(SwatchColor=RGB(0, 245, 53)), Width=2)
vector_display_ex_4 = VectorDisplayEx(Point=explode_tree.Branch0, Vector=explode_tree.Branch3, Colour=ColourSwatch(SwatchColor=RGB(0, 55, 255)), Width=2)
dot_display = DotDisplay(Point=explode_tree_5.Branch0, Colour=ColourSwatch(SwatchColor=RGB(107, 106, 102)), Size=explode_tree_5.Branch1)
tag = TextTag(Location=explode_tree_3.Branch0, Text=explode_tree_3.Branch1, Colour=ColourSwatch(SwatchColor=RGB(255, 0, 0)))
tag_2 = TextTag(Location=explode_tree_4.Branch0, Text=explode_tree_4.Branch1, Colour=ColourSwatch(SwatchColor=RGB(25, 0, 255)))

# ==== cluster DisassembleModel
alpacamodel = ClusterInput()
file_path = FilePath("C:\GitHub\Alpaca4d\PythonScript\Post-Processing\disassembleModel\disassembleModel.py")
read_file = ReadFile(File=file_path, PerLineParse=False)
python = GhPythonScript(Code=read_file, AlpacaModel=alpacamodel)  # -> ModelView, ModelViewExtruded, Points, Support, Load, Material, Section
modelview = ClusterOutput(python.ModelView)
modelviewextruded = ClusterOutput(python.ModelViewExtruded)
points = ClusterOutput(python.Points)
support = ClusterOutput(python.Support)
load = ClusterOutput(python.Load)
material = ClusterOutput(python.Material)
section = ClusterOutput(python.Section)

# ==== cluster SolverStaticAnalyses
alpacamodel = ClusterInput()
path = FilePath("C:\GitHub\Alpaca4d\PythonScript\Analyses\LinearAnalyses\initializeAnalysis.py")
# solver on folder Static Analyses 3ndf
path_2 = FilePath("C:\GitHub\Alpaca4d\PythonScript\Analyses\openSees_StaticSolver_3ndf\initializeAnalysis_3ndf.py")  # disabled
file = ReadFile(File=path, PerLineParse=False)
file_2 = ReadFile(File=path_2, PerLineParse=False)  # disabled
analyze = GhPythonScript(Code=file, AlpacaModel=alpacamodel)  # -> Out, AlpacaStaticOutput, MaxDisplacement
analyze_2 = GhPythonScript(Code=file_2, AlpacaModel=alpacamodel)  # -> Out, AlpacaStaticOutput; disabled
alpacastaticoutput = ClusterOutput(analyze.AlpacaStaticOutput)

# ==== cluster ModalAnalyses
path = FilePath("C:\GitHub\Alpaca4d\PythonScript\Analyses\DynamicAnalysis\initializeModalAnalyses.py")
numvibrationmodes = ClusterInput()
alpacamodel = ClusterInput()
file = ReadFile(File=path, PerLineParse=False)
analyze = GhPythonScript(Code=file, AlpacaModel=alpacamodel, NumVibrationModes=numvibrationmodes)  # -> Out, AlpacaModalOutput, Frequency, Period
alpacamodaloutput = ClusterOutput(analyze.AlpacaModalOutput)
frequency = ClusterOutput(analyze.Frequency)
period = ClusterOutput(analyze.Period)

# ==== cluster GroundMotionAnalyses

newmarkbeta = ClusterInput()
newmarkgamma = ClusterInput()
damping = ClusterInput()
timestepincrement = ClusterInput()
groundmotionfactor = ClusterInput()
groundmotiontimestep = ClusterInput()
groundmotionvalues = ClusterInput()
groundmotiondirection = ClusterInput()
tmaxanalyses = ClusterInput()
path = FilePath("C:\GitHub\Alpaca4d\PythonScript\Analyses\EarthQuakeAnalysis\initializeEarthQuakeAnalysis.py")
alpacamodel = ClusterInput()
file = ReadFile(File=path, PerLineParse=False)
analyze = GhPythonScript(
    Code=file,
    AlpacaModel=alpacamodel,
    TmaxAnalyses=tmaxanalyses,
    GroundMotionDirection=groundmotiondirection,
    GroundMotionValues=groundmotionvalues,
    GroundMotionTimeStep=groundmotiontimestep,
    GroundMotionFactor=groundmotionfactor,
    TimeStepIncrement=timestepincrement,
    Damping=damping,
    NewmarkGamma=newmarkgamma,
    NewmarkBeta=newmarkbeta)  # -> Out, AlpacaGroundmotionOutput, MaxDisplacement, MinDisplacement
alpacagroundmotionoutput = ClusterOutput(analyze.AlpacaGroundmotionOutput)
maxdisplacement = ClusterOutput(analyze.MaxDisplacement)
mindisplacement = ClusterOutput(analyze.MinDisplacement)

# ==== cluster DeformedModelView
modelexstrud = ClusterInput()
scale = ClusterInput()
file_path = FilePath("C:\GitHub\Alpaca4d\PythonScript\Post-Processing\defModelView\defModelView.py")
direction = ClusterInput()
read_file = ReadFile(File=file_path, PerLineParse=False)
alpacastaticoutput = ClusterInput()
python = GhPythonScript(Code=read_file, AlpacaStaticOutput=alpacastaticoutput, Direction=direction, Scale=scale, ModelExstrud=modelexstrud)  # -> Out, ModelDisp, ModelCurve, Max_min
modeldisp = ClusterOutput(python.ModelDisp)
max_min = ClusterOutput(python.Max_min)
explode_tree = ExplodeTree(Data=python.ModelCurve)  # -> Branch0, Branch1, Branch2
divide_curve = DivideCurve(Curve=explode_tree.Branch0, Count=explode_tree.Branch1, Kinks=False)  # -> Points, Tangents, simplify(Parameters)
shatter = Shatter(Curve=graft(explode_tree.Branch0), Parameters=divide_curve.Parameters)  # -> simplify(Segments)
curve_direction = GhPythonScript(Crv=flatten(shatter), Thickness=Slider(2, range=0..10), RGB=explode_tree.Branch2)  # -> out; inputs Crv: list of Curve, RGB: list of Color; same code as curve_direction

# ==== cluster NodeDisp
file_path = FilePath("C:\GitHub\Alpaca4d\PythonScript\Post-Processing\nodalDisp\nodalDisp.py")
read_file = ReadFile(File=file_path, PerLineParse=False)
alpacastaticoutput = ClusterInput()

# ---- group: NodeDisp
python = GhPythonScript(Code=read_file, AlpacaStaticOutput=alpacastaticoutput)  # -> Out, Points, Trans, Rot

# ----
points = ClusterOutput(python.Points)
trans = ClusterOutput(python.Trans)
rot = ClusterOutput(python.Rot)

# ==== cluster BrickDisplacement
file_path = FilePath("C:\GitHub\Alpaca4d\PythonScript\Post-Processing\brickDisp\brickDisp.py")
alpacastaticoutput = ClusterInput()
read_file = ReadFile(File=file_path, PerLineParse=False)
python = GhPythonScript(Code=read_file, AlpacaStaticOutput=alpacastaticoutput)  # -> Out, TagElement, Trans
out = ClusterOutput(python.Out)
tagelement = ClusterOutput(python.TagElement)
trans = ClusterOutput(python.Trans)

# ==== cluster ShellDisplacement
file_path = FilePath("C:\GitHub\Alpaca4d\PythonScript\Post-Processing\shellDisp\shellDisp.py")
alpacastaticoutput = ClusterInput()
read_file = ReadFile(File=file_path, PerLineParse=False)

# ---- group: Shell Displacement
python = GhPythonScript(Code=read_file, AlpacaStaticOutput=alpacastaticoutput)  # -> Out, TagElement, Trans, Rot

# ----
tagelement = ClusterOutput(python.TagElement)
trans = ClusterOutput(python.Trans)
rot = ClusterOutput(python.Rot)

# ==== cluster BeamDisplacement
file_path = FilePath("C:\GitHub\Alpaca4d\PythonScript\Post-Processing\beamDisp\beamDisp.py")
alpacastaticoutput = ClusterInput()
numberresults = ClusterInput()
read_file = ReadFile(File=file_path, PerLineParse=False)

# ---- group: Beam Displacement
python = GhPythonScript(Code=read_file, AlpacaStaticOutput=alpacastaticoutput, NumberResults=numberresults)  # -> Out, TagElement, LocalTrans, LocalRot, GlobalTrans, GlobalRot

# ----
tagelement = ClusterOutput(python.TagElement)
localtrans = ClusterOutput(python.LocalTrans)
localrot = ClusterOutput(python.LocalRot)
globaltrans = ClusterOutput(python.GlobalTrans)
globalrot = ClusterOutput(python.GlobalRot)

# ==== cluster ModalAnimate
scale = ClusterInput()
direction = ClusterInput()
modelexstrud = ClusterInput()
reset = ClusterInput()
animate = ClusterInput()
speed = ClusterInput()
openseesoutputwrapper = ClusterInput()
numbermode = ClusterInput()

# ----
# Modal Animate
path = FilePath("C:\GitHub\Alpaca4d\PythonScript\Post-Processing\animateModal\animateModal.py")
file = ReadFile(File=path, PerLineParse=False)

# ---- group: MODAL ANALYSIS
ghpython_script = GhPythonScript(
    Code=file,
    OpenSeesOutputWrapper=openseesoutputwrapper,
    NumberMode=numbermode,
    Speed=speed,
    Animate=animate,
    Reset=reset,
    Scale=scale,
    Direction=direction,
    ModelExstrud=modelexstrud)  # -> Out, ModelDisp, ModelCurve, Max_min

# ----
max_min = ClusterOutput(ghpython_script.Max_min)

modeldisp = ClusterOutput(ghpython_script.ModelDisp)
explode_tree = ExplodeTree(Data=ghpython_script.ModelCurve)  # -> Branch0, Branch1, Branch2
divide_curve = DivideCurve(Curve=explode_tree.Branch0, Count=explode_tree.Branch1, Kinks=False)  # -> Points, Tangents, simplify(Parameters)
shatter = Shatter(Curve=graft(explode_tree.Branch0), Parameters=divide_curve.Parameters)  # -> simplify(Segments)
curve_direction = GhPythonScript(Crv=flatten(shatter), Thickness=Slider(3, range=0..10), RGB=explode_tree.Branch2)  # -> out; inputs Crv: list of Curve, RGB: list of Color; same code as curve_direction

# ==== cluster GroundMotionView
modelexstrud = ClusterInput()
direction = ClusterInput()
scale = ClusterInput()
reset = ClusterInput()
animate = ClusterInput()
speed = ClusterInput()
path = FilePath("C:\GitHub\Alpaca4d\PythonScript\Post-Processing\viewGroundAccAnalyses\viewGroundAccAnalyses.py")
openseesoutputwrapper = ClusterInput()
file = ReadFile(File=path, PerLineParse=False)

ghpython_script = GhPythonScript(
    Code=file,
    OpenSeesOutputWrapper=openseesoutputwrapper,
    Speed=speed,
    Animate=animate,
    Reset=reset,
    Scale=scale,
    Direction=direction,
    ModelExstrud=modelexstrud)  # -> Out, ModelDisp, ModelCurve, Trans, Rot
modeldisp = ClusterOutput(ghpython_script.ModelDisp)
explode_tree = ExplodeTree(Data=ghpython_script.ModelCurve)  # -> Branch0, Branch1, Branch2
divide_curve = DivideCurve(Curve=explode_tree.Branch0, Count=explode_tree.Branch1, Kinks=False)  # -> Points, Tangents, simplify(Parameters)
shatter = Shatter(Curve=graft(explode_tree.Branch0), Parameters=divide_curve.Parameters)  # -> simplify(Segments)
curve_direction = GhPythonScript(Crv=flatten(shatter), Thickness=Slider(3, range=0..10), RGB=explode_tree.Branch2)  # -> out; inputs Crv: list of Curve, RGB: list of Color; same code as curve_direction

trans = ClusterOutput(ghpython_script.Trans)
rot = ClusterOutput(ghpython_script.Rot)

# ==== cluster Reaction
scale = ClusterInput()
reactionmomentsview = ClusterInput()
file_path = FilePath("C:\GitHub\Alpaca4d\PythonScript\Post-Processing\reaction\reaction.py")
reactionforcesview = ClusterInput()
read_file = ReadFile(File=file_path, PerLineParse=False)
alpacastaticoutput = ClusterInput()
python = GhPythonScript(
    Code=read_file,
    AlpacaStaticOutput=alpacastaticoutput,
    ReactionForcesView=reactionforcesview,
    ReactionMomentsView=reactionmomentsview,
    Scale=scale)  # -> Out, TagPoints, ReactionForce, ReactionMoment, View
reactionforce = ClusterOutput(python.ReactionForce)
tagpoints = ClusterOutput(python.TagPoints)
reactionmoment = ClusterOutput(python.ReactionMoment)
explode_tree = ExplodeTree(Data=python.View)  # -> Branch0, Branch1, Branch2, Branch3, Branch4, Branch5, Branch6
vector_display_ex = VectorDisplayEx(
    Point=explode_tree.Branch0,
    Vector=[explode_tree.Branch3, explode_tree.Branch2, explode_tree.Branch1],
    Colour=ColourSwatch(SwatchColor=RGB(252, 0, 0)),
    Width=2)
vector_display_ex_2 = VectorDisplayEx(
    Point=explode_tree.Branch0,
    Vector=[explode_tree.Branch6, explode_tree.Branch5, explode_tree.Branch4],
    Colour=ColourSwatch(SwatchColor=RGB(0, 55, 255)),
    Width=2)

# ==== cluster BeamForces
file_path = FilePath("C:\GitHub\Alpaca4d\PythonScript\Post-Processing\beamForces\beamForces.py")
alpacastaticoutput = ClusterInput()
read_file = ReadFile(File=file_path, PerLineParse=False)
numberresults = ClusterInput()
python = GhPythonScript(Code=read_file, AlpacaStaticOutput=alpacastaticoutput, NumberResults=numberresults)  # -> Out, TagElement, N, V1, V2, Mt, M1, M2
N = ClusterOutput(python.N)
v1 = ClusterOutput(python.V1)
tagelement = ClusterOutput(python.TagElement)
v2 = ClusterOutput(python.V2)
mt = ClusterOutput(python.Mt)
m1 = ClusterOutput(python.M1)
m2 = ClusterOutput(python.M2)

# ==== cluster ForcesView
scale = ClusterInput()
file_path = FilePath("C:\GitHub\Alpaca4d\PythonScript\Post-Processing\cdsView\cdsView.py")
cds = ClusterInput()
read_file = ReadFile(File=file_path, PerLineParse=False)
alpacastaticoutput = ClusterInput()
python = GhPythonScript(Code=read_file, AlpacaStaticOutput=alpacastaticoutput, Cds=cds, Scale=scale)
diagram = ClusterOutput(python)

# ==== cluster ShellForcesValue
file_path = FilePath("C:\GitHub\Alpaca4d\PythonScript\Post-Processing\shellForces\shellForces.py")
alpacastaticoutput = ClusterInput()
read_file = ReadFile(File=file_path, PerLineParse=False)
python = GhPythonScript(Code=read_file, AlpacaStaticOutput=alpacastaticoutput)  # -> Out, TagElement, Fx, Fy, Fz, Mx, My, Mz
tagelement = ClusterOutput(python.TagElement)
fx = ClusterOutput(python.Fx)
fy = ClusterOutput(python.Fy)
fz = ClusterOutput(python.Fz)
mx = ClusterOutput(python.Mx)
my = ClusterOutput(python.My)
mz = ClusterOutput(python.Mz)

# ==== cluster ShellForcesView
file_path = FilePath("C:\GitHub\Alpaca4d\PythonScript\Post-Processing\shellForceView\shellForceView.py")
ncolor = ClusterInput()
viewforce = ClusterInput()
read_file = ReadFile(File=file_path, PerLineParse=False)
alpacastaticoutput = ClusterInput()
python = GhPythonScript(Code=read_file, AlpacaStaticOutput=alpacastaticoutput, ViewForce=viewforce)  # -> ModelForce, ForceValue
bounds = Bounds(Numbers=flatten(python.ForceValue))
file_path_2 = FilePath("C:\GitHub\Alpaca4d\PythonScript\function\AlpacaColorMesh.py")
deconstruct_domain = DeconstructDomain(Domain=bounds)  # -> Start, End
read_file_2 = ReadFile(File=file_path_2, PerLineParse=False)
ghpython_script = GhPythonScript(Code=read_file_2, Min=deconstruct_domain.Start, Max=deconstruct_domain.End, Value=python.ForceValue, NColor=ncolor)  # -> Out, Color, Tag, Domain, ColorValue
split_tree = SplitTree(Data=simplify(ghpython_script.Color), Masks=simplify("{0}"))  # -> Positive, Negative
split_tree_2 = SplitTree(Data=simplify(ghpython_script.Tag), Masks=simplify("{0}"))  # -> Positive, Negative
split_tree_3 = SplitTree(Data=simplify(ghpython_script.Domain), Masks=simplify("{0}"))  # -> Positive, Negative
mesh_colours = MeshColours(Mesh=graft(python.ModelForce), Colours=ghpython_script.ColorValue)
positive = ClusterOutput(split_tree_2.Positive)
mesh = ClusterOutput(mesh_colours)
positive_2 = ClusterOutput(split_tree.Positive)

# ==== cluster ShellStressView
file_path = FilePath("C:\GitHub\Alpaca4d\PythonScript\Post-Processing\shellStressView\shellStressView.py")
alpacastaticoutput = ClusterInput()
stressview = ClusterInput()
ncolor = ClusterInput()
read_file = ReadFile(File=file_path, PerLineParse=False)
python = GhPythonScript(Code=read_file, AlpacaStaticOutput=alpacastaticoutput, StressView=stressview)  # -> Shell, StressValue
bounds = Bounds(Numbers=flatten(python.StressValue))
stressvalue = ClusterOutput(python.StressValue)
file_path_2 = FilePath("C:\GitHub\Alpaca4d\PythonScript\function\AlpacaColorMesh.py")
deconstruct_domain = DeconstructDomain(Domain=bounds)  # -> Start, End
read_file_2 = ReadFile(File=file_path_2, PerLineParse=False)
ghpython_script = GhPythonScript(Code=read_file_2, Min=deconstruct_domain.Start, Max=deconstruct_domain.End, Value=python.StressValue, NColor=ncolor)  # -> Out, Color, Tag, Domain, ColorValue
split_tree = SplitTree(Data=simplify(ghpython_script.Color), Masks=simplify("{0}"))  # -> Positive, Negative
split_tree_2 = SplitTree(Data=simplify(ghpython_script.Tag), Masks=simplify("{0}"))  # -> Positive, Negative
split_tree_3 = SplitTree(Data=simplify(ghpython_script.Domain), Masks=simplify("{0}"))  # -> Positive, Negative
mesh_colours = MeshColours(Mesh=graft(python.Shell), Colours=ghpython_script.ColorValue)
domain = ClusterOutput(split_tree_3.Positive)
tag = ClusterOutput(split_tree_2.Positive)
color = ClusterOutput(split_tree.Positive)
mesh = ClusterOutput(mesh_colours)

# ==== cluster BrickStressView
file_path = FilePath("C:\GitHub\Alpaca4d\PythonScript\Post-Processing\brickStress\brickStress.py")
ncolor = ClusterInput()
alpacastaticoutput = ClusterInput()
stressview = ClusterInput()
read_file = ReadFile(File=file_path, PerLineParse=False)
python = GhPythonScript(Code=read_file, AlpacaStaticOutput=alpacastaticoutput, StressView=stressview)  # -> Brick, StressValue
stressvalue = ClusterOutput(python.StressValue)
bounds = Bounds(Numbers=flatten(python.StressValue))
deconstruct_domain = DeconstructDomain(Domain=bounds)  # -> Start, End
ghpython_script = GhPythonScript(min=deconstruct_domain.Start, max=deconstruct_domain.End, value=python.StressValue, nColor=ncolor)  # -> out, color, tag, domain, colorValue; inputs value: list, nColor: Int32
# ---------- ghpython_script: Python ----------
import Rhino.Geometry as rg
import ghpythonlib.components as ghcomp
import math as mt
import ghpythonlib.treehelpers as th # per data tree
import Grasshopper
#import System as sy #DV
import sys
import rhinoscriptsyntax as rs

'''
ghFilePath = ghenv.LocalScope.ghdoc.Path
ghFileName = ghenv.LocalScope.ghdoc.Name
folderNameLength = len(ghFilePath)-len(ghFileName)-2 #have to remove '.gh'
ghFolderPath = ghFilePath[0:folderNameLength]

outputPath = ghFolderPath + 'assembleData'
wrapperFile = ghFolderPath + 'assembleData\\openSeesModel.txt'

userObjectFolder = Grasshopper.Folders.DefaultUserObjectFolder
fileName = userObjectFolder + 'Alpaca'
'''
fileName = r'C:\GitHub\Alpaca4d\PythonScript\function'
sys.path.append(fileName)
# importante mettere import 'import Rhino.Geometry as rg' prima di importatre DomeFunc
import DomeFunc as dg 
def gradientJet(value, valueMax, valueMin, nColor):
    if nColor == 0:
        listcolo = [rs.CreateColor( 0, 0, 255 ),
                    rs.CreateColor( 0, 128, 255 ),
                    rs.CreateColor( 0, 255, 255 ),
                    rs.CreateColor( 0, 255, 128 ),
                    rs.CreateColor( 128, 255, 0 ),
                    rs.CreateColor( 255, 255, 0 ),
                    rs.CreateColor( 255, 128, 0 ),
                    rs.CreateColor( 204, 0, 0 )]
    elif nColor == 1:
        listcolo = [ rs.CreateColor( 0, 0, 102 ),
                    rs.CreateColor( 0, 0, 255 ),
                    rs.CreateColor( 0, 64, 255 ),
                    rs.CreateColor( 0, 128, 255 ),
                    rs.CreateColor( 0, 191, 255 ),
                    rs.CreateColor( 0, 255, 255 ),
                    rs.CreateColor( 0, 255, 191 ),
                    rs.CreateColor( 0, 255, 128 ),
                    rs.CreateColor( 0, 255, 64 ),
                    rs.CreateColor( 0, 255, 0 ),
                    rs.CreateColor( 64, 255, 0 ),
                    rs.CreateColor( 128, 255, 0 ),
                    rs.CreateColor( 191, 255, 0 ),
                    rs.CreateColor( 255, 255, 0 ),
                    rs.CreateColor( 255, 191, 0 ),
                    rs.CreateColor( 255, 128, 0 ),
                    rs.CreateColor( 255, 64, 0 ),
                    rs.CreateColor( 255, 0, 0 ),
                    rs.CreateColor( 230, 0, 0 ),
                    rs.CreateColor( 204, 0, 0 )]
    #domain = linspace( valueMin,  valueMax, len( listcolo ) )
    n = len( listcolo )
    domain = dg.linspace( valueMin, valueMax, n)
    
    for i in range(1,n):
        if  domain[i-1] <= value <= domain[i]:
            return listcolo[ i ]
        elif  valueMax <= value <= valueMax + 0.00001 :
            return listcolo[ -1 ]
        elif  valueMin - 0.00000000001 <= value <= valueMin  :
            return listcolo[ 0 ]

def gradientJet2(valueMax, valueMin, nColor ):

    if nColor == 0:
        listcolo = [rs.CreateColor( 0, 0, 255 ),
                    rs.CreateColor( 0, 128, 255 ),
                    rs.CreateColor( 0, 255, 255 ),
                    rs.CreateColor( 0, 255, 128 ),
                    rs.CreateColor( 128, 255, 0 ),
                    rs.CreateColor( 255, 255, 0 ),
                    rs.CreateColor( 255, 128, 0 ),
                    rs.CreateColor( 204, 0, 0 )]
    elif nColor == 1:
        listcolo = [ rs.CreateColor( 0, 0, 102 ),
                    rs.CreateColor( 0, 0, 255 ),
                    rs.CreateColor( 0, 64, 255 ),
                    rs.CreateColor( 0, 128, 255 ),
                    rs.CreateColor( 0, 191, 255 ),
                    rs.CreateColor( 0, 255, 255 ),
                    rs.CreateColor( 0, 255, 191 ),
                    rs.CreateColor( 0, 255, 128 ),
                    rs.CreateColor( 0, 255, 64 ),
                    rs.CreateColor( 0, 255, 0 ),
                    rs.CreateColor( 64, 255, 0 ),
                    rs.CreateColor( 128, 255, 0 ),
                    rs.CreateColor( 191, 255, 0 ),
                    rs.CreateColor( 255, 255, 0 ),
                    rs.CreateColor( 255, 191, 0 ),
                    rs.CreateColor( 255, 128, 0 ),
                    rs.CreateColor( 255, 64, 0 ),
                    rs.CreateColor( 255, 0, 0 ),
                    rs.CreateColor( 230, 0, 0 ),
                    rs.CreateColor( 204, 0, 0 )]

    #domain = linspace( valueMin,  valueMax, len( listcolo ) )
    n = len( listcolo )
    diff = (float(valueMax) - valueMin)/( n - 1 )
    domain = [diff * i + valueMin  for i in range(n)]
    return [ listcolo, domain ]

colorList = gradientJet2( max, min, nColor )
color = colorList[0]  #.reverse()
color.reverse()
tag = []
tag.append( str(round(colorList[1][0],2) ) )
for i in range(1,len(colorList[1])):
    tag.append( str(round(colorList[1][i-1],2)) + '< valor < ' + str(round(colorList[1][i],2)) )
domain = colorList[1]
tag.reverse()

colorValue = []
for i in value:
    colorValue.append(gradientJet(i, max, min, nColor))
    print(len(value))
# ---------- end ghpython_script ----------
split_tree = SplitTree(Data=simplify(ghpython_script.color), Masks=simplify("{0}"))  # -> Positive, Negative
split_tree_2 = SplitTree(Data=simplify(ghpython_script.tag), Masks=simplify("{0}"))  # -> Positive, Negative
mesh_colours = MeshColours(Mesh=graft(python.Brick), Colours=ghpython_script.colorValue)
split_tree_3 = SplitTree(Data=simplify(ghpython_script.domain), Masks=simplify("{0}"))  # -> Positive, Negative
mesh = ClusterOutput(mesh_colours)
color = ClusterOutput(split_tree.Positive)
domain = ClusterOutput(split_tree_3.Positive)
tag = ClusterOutput(split_tree_2.Positive)
