# Grasshopper definition GrasshopperScript.gh (Grasshopper 1.0.7)
# plug-ins: MeshEdit Components, Human, Kangaroo Components, LunchBox, Weaverbird, Kangaroo2 Components, TetgenGH

brep = Brep(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)
mesh = MeshBrep(
    Brep=brep,
    Settings={GridMaxCount=0, GridMinCount=16, JaggedSeams=False, MaxEdgeLength=0, MinEdgeLength=0.0001, MinTolerance=0, Refine=True, RefineAngle=0, RelativeTolerance=0, SimplePlanes=True, Tolerance=0})
tetgen = Tetrahedralize(Mesh=mesh, Flags=Slider(0, range=0..10), MinRatio=Slider(1.3, range=0..10))  # -> Mesh, Indices, Points
deconstruct_mesh = DeconstructMesh(Mesh=tetgen.Mesh)  # -> Vertices, Faces, Colours, Normals
removeduplicatepts = RemoveDuplicatePts(Points=flatten(deconstruct_mesh.Vertices), Tolerance=0.01)
pdecon = Deconstruct(Point=removeduplicatepts)  # -> XComponent, YComponent, ZComponent
pdecon_2 = Deconstruct(Point=removeduplicatepts)  # -> XComponent, YComponent, ZComponent
larger_than = LargerThan(FirstNumber=pdecon.XComponent, SecondNumber="25")  # -> LargerThan, OrEqualTo
smaller = SmallerThan(FirstNumber=pdecon_2.XComponent, SecondNumber="0.1")  # -> SmallerThan, OrEqualTo
cull = CullPattern(List=removeduplicatepts, CullPattern=smaller.SmallerThan)  # -> graft(List)
cull_2 = CullPattern(List=removeduplicatepts, CullPattern=larger_than.LargerThan)  # -> graft(List)
point = Point(cull)
point_2 = Point(cull_2)
support = Point(point)
pointload = Point(point_2)
vec = VectorXYZ(XComponent=0, YComponent=0, ZComponent="-100")  # -> Vector, Length
entwine = Entwine(Branch03=support, Branch04=pointload, Branch05=vec.Vector, Branch012=graft(tetgen.Mesh), FlattenInputs=True)

number_slider = Slider(30, range=0..100)

# ---- group: Element
data = Data(0)
data_2 = Data(0)

# ---- group: Load
data_3 = Data(0)
data_4 = Data(0)

# ---- group: Cross-Section
data_5 = Data(0)
data_6 = Data(0)

# ---- group: Support
data_7 = Data(0)
data_8 = Data(0)

# ----
# Model 4
number_slider_2 = Slider(60, range=0..100)
construct_point = ConstructPoint(XCoordinate=0, YCoordinate=0, ZCoordinate=0)
construct_point_2 = ConstructPoint(XCoordinate=number_slider_2, YCoordinate=0, ZCoordinate=0)
unit_z = UnitZ(Factor=Slider(10, range=0..10))
line = Line(StartPoint=construct_point, EndPoint=construct_point_2)
move = Move(Geometry=line, Motion=unit_z)  # -> Geometry, Transform
panel = Panel(number_slider_2)
_2d_truss = _2DTruss(CurveA=line, CurveB=move.Geometry, Divisions=Slider(5, range=0..10), TrussToggle=0)  # -> PrimaryLines, BraceLines, VerticalLines, StructureNodes
pdecon_3 = Deconstruct(Point=_2d_truss.StructureNodes)  # -> XComponent, YComponent, ZComponent
pdecon_4 = Deconstruct(Point=_2d_truss.StructureNodes)  # -> XComponent, YComponent, ZComponent
equality = Equality(FirstNumber=pdecon_4.XComponent, SecondNumber=panel)  # -> Equality, Inequality
smaller_2 = SmallerThan(FirstNumber=pdecon_3.XComponent, SecondNumber="0.1")  # -> SmallerThan, OrEqualTo
merge = Merge(Data1=_2d_truss.PrimaryLines, Data2=_2d_truss.BraceLines, Data3=_2d_truss.VerticalLines)
cull_3 = CullPattern(List=_2d_truss.StructureNodes, CullPattern=equality.Equality)  # -> flatten(List)
cull_4 = CullPattern(List=_2d_truss.StructureNodes, CullPattern=smaller_2.SmallerThan)  # -> flatten(List)
vec_2 = VectorXYZ(XComponent=0, YComponent=0, ZComponent="-100")  # -> Vector, Length
pointload_2 = Point(cull_3)
support_2 = Point(cull_4)
beam = Curve(merge)
entwine_2 = Entwine(Branch01=beam, Branch03=support_2, Branch04=pointload_2, Branch05=vec_2.Vector, FlattenInputs=True)

series = Series(Start="0", Step="0.50", Count="2")

# ---- group: Material
data_9 = Data(0)
data_10 = Data(0)

# ---- group: Constraint
data_11 = Data(0)
data_12 = Data(0)

# ----
curve = Curve([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])

# ----
# Model 2
number_slider_3 = Slider(6, range=0..10)
vector_xyz = VectorXYZ(XComponent=0, YComponent=0, ZComponent=0)  # -> Vector, Length
vector_xyz_2 = VectorXYZ(XComponent=0, YComponent=0, ZComponent=number_slider_3)  # -> Vector, Length
move_2 = Move(Geometry=vector_xyz.Vector, Motion=vector_xyz_2.Vector)  # -> Geometry, Transform
line_2 = Line(StartPoint=vector_xyz.Vector, EndPoint=move_2.Geometry)
num = Number("0")
pointload_3 = Point(move_2.Geometry)
vec_3 = VectorXYZ(XComponent=0, YComponent=Slider(6, range=-20..20), ZComponent=0)  # -> Vector, Length
pointload_4 = Point(move_2.Geometry)
vec_4 = VectorXYZ(XComponent=Slider(0, range=-20..20), YComponent=0, ZComponent=0)  # -> Vector, Length
support_3 = Point(vector_xyz.Vector)
beam_2 = Curve(line_2)
columns = Curve(beam_2)
entwine_3 = Entwine(
    Branch01=beam_2,
    Branch03=support_3,
    Branch04=pointload_4,
    Branch05=vec_3.Vector,
    Branch06=columns,
    Branch07=vec_4.Vector,
    Branch010=pointload_3,
    Branch011=num,
    FlattenInputs=True)

# ----
# Model 1
number_slider_4 = Slider(10, range=0..40)
number_slider_5 = Slider(20, range=0..40)
panel_2 = Panel("2")
mesh_plane = MeshPlane(
    Boundary={Plane=PlaneXY(0, 0, 0), Size=Domain2(u=-10..10, v=-10..10)},
    WidthCount=number_slider_4,
    HeightCount=number_slider_4)  # -> Mesh, Area
shell = Mesh(mesh_plane.Mesh)
clean = CombineClean(Meshes=shell)
explode = MeshExplode(Mesh=clean, Interpolate=False)  # -> flatten(Faces)
demesh = DeconstructMesh(Mesh=clean)  # -> Vertices, Faces, Colours, Normals
area = Area(Geometry=mesh_plane.Mesh)  # -> Area, Centroid
area_2 = Area(Geometry=explode)  # -> Area, Centroid
distance = Distance(PointA=area.Centroid, PointB=area_2.Centroid)
bounds = Bounds(Numbers=distance)
nakedvertices = NakedVertices(Mesh=mesh_plane.Mesh)  # -> ClothedIndex, NakedIndex, ClothedPts, NakedPts
difference = SetDifference(SetA=demesh.Vertices, SetB=nakedvertices.NakedPts)
mc = MeshCorners(Mesh=clean, Angle=2.35619449)
deconstruct_domain = DeconstructDomain(Domain=bounds)  # -> Start, End
vec_5 = VectorXYZ(XComponent=Slider(17, range=-20..20), YComponent=Slider(20, range=-20..20), ZComponent=Slider(-100, range=-100..20))  # -> Vector, Length
maximum = Maximum(A=deconstruct_domain.Start, B=deconstruct_domain.End)
pointload_5 = Point(difference)
support_4 = Point(nakedvertices.NakedPts)
similarity = Similarity(FirstNumber=distance, SecondNumber=maximum, Threshold=Slider(1e-06, range=0..1e-06))  # -> Similarity, AbsoluteDifference
dispatch = Dispatch(List=explode, DispatchPattern=similarity.Similarity)  # -> ListA, ListB
entwine_4 = Entwine(Branch00=explode, Branch03=support_4, Branch04=pointload_5, Branch05=vec_5.Vector, FlattenInputs=True)

explode_2 = Explode(Curve=curve, Recursive=True)  # -> Segments, Vertices
unit_z_2 = UnitZ(Factor=series)
removeduplicatepts_2 = RemoveDuplicatePts(Points=flatten(explode_2.Vertices), Tolerance=0.01)
construct_domain = ConstructDomain(DomainStart=Slider(1, range=0..1), DomainEnd=Slider(8, range=0..10))
deconstruct = Deconstruct(Point=removeduplicatepts_2)  # -> XComponent, YComponent, ZComponent
vec_6 = VectorXYZ(XComponent=Slider(11, range=-20..20), YComponent=Slider(11, range=-20..20), ZComponent=0)  # -> Vector, Length
panel_3 = Panel("0.50")
smaller_than = SmallerThan(FirstNumber=deconstruct.ZComponent, SecondNumber="1")  # -> SmallerThan, OrEqualTo
series_2 = Series(Start="0", Step="0.50", Count=Slider(3, range=0..10))
list = ValueList({"Building": 0, "Shell": 1, "Cantiliver": 2, "Brick esaedro": 3, "Truss": 4, "telaio": 5, "Brick tetraedro": 6, "Building  2": 7}, selected="Building  2")
construct_domain_2 = ConstructDomain(DomainStart=Slider(1, range=0..1), DomainEnd=Slider(8, range=0..10))
dispatch_2 = Dispatch(List=removeduplicatepts_2, DispatchPattern=smaller_than.SmallerThan)  # -> ListA, ListB
unit_z_3 = UnitZ(Factor=series_2)
vec_7 = VectorXYZ(XComponent=Slider(11, range=-20..20), YComponent=Slider(11, range=-20..20), ZComponent=0)  # -> Vector, Length
addition = Addition(A="25", B=Slider(30, range=0..100))
vector_xyz_3 = VectorXYZ(XComponent=addition, YComponent=Slider(30, range=0..100), ZComponent=Slider(43, range=0..100))  # -> Vector, Length
point_3 = Point(vector_xyz_3.Vector)
line_3 = Line(StartPoint=cull_2, EndPoint=point_3)
item_index = ItemIndex(List=explode, Item=dispatch.ListA)
mesh_2 = Mesh(dispatch.ListA)

# ----
# UniaxialMaterial
# Elastic
file_path = FilePath("C:\GitHub\Alpaca4d\PythonScript\Pre-Processing\Material\uniAxialMaterial\ElasticUniaxialMaterial.py")
read_file = ReadFile(File=file_path, PerLineParse=False)
python = GhPythonScript(Code=read_file, MatName="S275", E="210000", G="80760", Rho="75", Fy="35")  # -> Out, ElasticMaterialWrapper
python_2 = GhPythonScript(x=python.ElasticMaterialWrapper)  # -> out, a
# ---------- python_2: Python ----------
a = x
# ---------- end python_2 ----------
panel_4 = Panel(python_2.a)

# ----
# UniaxialMaterial
# Elastic
panel_5 = Panel("210000")
python_3 = GhPythonScript(Code=read_file, MatName="S255", E=panel_5, G="80760", Rho="75", Fy="25")  # -> Out, ElasticMaterialWrapper
python_4 = GhPythonScript(x=python_3.ElasticMaterialWrapper)  # -> out, a; same code as python_2
panel_6 = Panel(python_4.a)

# ----
# nDMaterial
# ElasticIsotropic
file_path_2 = FilePath("C:\GitHub\Alpaca4d\PythonScript\Pre-Processing\Material\nDMaterial\ElasticIsotropic.py")
read_file_2 = ReadFile(File=file_path_2, PerLineParse=False)
python_5 = GhPythonScript(Code=read_file_2, MatName="S275", E="210000", G="80760", Rho="75", Fy="35")  # -> Out, ElasticMaterialWrapper

# ----
# Generic Cross Section
file_path_3 = FilePath("C:\GitHub\Alpaca4d\PythonScript\Pre-Processing\Section\GenericCrossSection.py")
read_file_3 = ReadFile(File=file_path_3, PerLineParse=False)
python_6 = GhPythonScript(
    Code=read_file_3,
    SectionName="Generic",
    Area="20",
    Ay="20",
    Az="20",
    Iyy="20",
    Izz="20",
    J="20",
    Material=python.ElasticMaterialWrapper)  # -> Out, CrossSection

file_path_4 = FilePath("C:\GitHub\Alpaca4d\PythonScript\Pre-Processing\Load\BeamLoad.py")

# ----
# WIP
panel_7 = Panel("100")
random = Random(Range="20", Number=panel_7, Seed=2)
random_2 = Random(Range="20", Number=panel_7, Seed="3")
pt = ConstructPoint(XCoordinate=random, YCoordinate=random_2, ZCoordinate=0)
python_7 = GhPythonScript(Pos=pt, RigidDiaphragm=Toggle(True))  # -> Out, A

# ----
# Circular CrossSection
file_path_5 = FilePath("C:\GitHub\Alpaca4d\PythonScript\Pre-Processing\Section\CircularCrossSection.py")
read_file_4 = ReadFile(File=file_path_5, PerLineParse=False)
python_8 = GhPythonScript(Code=read_file_4, SectionName="CHS", Diameter="400", Thickness="20", Material=python_3.ElasticMaterialWrapper)  # -> Out, CrossSection

read_file_5 = ReadFile(File=file_path_4, PerLineParse=False)

# ----
# Elastic Membrane Plate Section
file_path_6 = FilePath("C:\GitHub\Alpaca4d\PythonScript\Pre-Processing\Section\ElasticMembranePlateSection.py")
read_file_6 = ReadFile(File=file_path_6, PerLineParse=False)
python_9 = GhPythonScript(Code=read_file_6, SectionName="concreteSlab", Thickness="300", Material=python_5.ElasticMaterialWrapper)  # -> Out, PlateFiberSection

# ----
# doubleT CrossSection
file_path_7 = FilePath("C:\GitHub\Alpaca4d\PythonScript\Pre-Processing\Section\doubleTCrossSection.py")
read_file_7 = ReadFile(File=file_path_7, PerLineParse=False)
python_10 = GhPythonScript(
    Code=read_file_7,
    SectionName="TT",
    Bsup="300",
    Binf="600",
    H="500",
    Tsup="100",
    Tinf="100",
    Ta="100",
    Material=python_3.ElasticMaterialWrapper)  # -> Out, CrossSection

# ----
# Rectangular Cross Section
file_path_8 = FilePath("C:\GitHub\Alpaca4d\PythonScript\Pre-Processing\Section\RectangularCrossSection.py")
read_file_8 = ReadFile(File=file_path_8, PerLineParse=False)
python_11 = GhPythonScript(Code=read_file_8, SectionName="RHS", Base="300", Height="300", Material=python.ElasticMaterialWrapper)  # -> Out, CrossSection

colour_swatch = ColourSwatch(SwatchColor=RGB(0, 0, 0))
toggle = BooleanToggle(False)  # disabled
path = FilePath("C:\GitHub\Alpaca4d\PythonScript\Analyses\LinearAnalyses\initializeAnalysis.py")
# solver on folder Static Analyses 3ndf
path_2 = FilePath("C:\GitHub\Alpaca4d\PythonScript\Analyses\openSees_StaticSolver_3ndf\initializeAnalysis_3ndf.py")  # disabled
# solver on folder Static Analyses
file = ReadFile(File=path, PerLineParse=False)
panel_8 = Panel("0.005")  # disabled
file_2 = ReadFile(File=path_2, PerLineParse=False)  # disabled
number_slider_6 = Slider(6000, range=0..10000)  # disabled
number_slider_7 = Slider(3, range=0..100)  # disabled

# ----
# Numerical Ouput
# OK!
number_slider_8 = Slider(10, range=0..10)  # disabled
file_path_9 = FilePath("C:\GitHub\Alpaca4d\PythonScript\Post-Processing\beamDisp\beamDisp.py")  # disabled
file_path_10 = FilePath("C:\GitHub\Alpaca4d\PythonScript\Post-Processing\shellDisp\shellDisp.py")  # disabled
file_path_11 = FilePath("C:\GitHub\Alpaca4d\PythonScript\Post-Processing\nodalDisp\nodalDisp.py")  # disabled
file_path_12 = FilePath("C:\GitHub\Alpaca4d\PythonScript\Post-Processing\brickDisp\brickDisp.py")  # disabled
read_file_9 = ReadFile(File=file_path_9, PerLineParse=False)  # disabled
read_file_10 = ReadFile(File=file_path_10, PerLineParse=False)  # disabled
read_file_11 = ReadFile(File=file_path_11, PerLineParse=False)  # disabled
read_file_12 = ReadFile(File=file_path_12, PerLineParse=False)  # disabled

list_2 = ValueList({"8Color": 0, "20Color": 1}, selected="20Color")  # disabled
list_3 = ValueList({"8Color": 0, "20Color": 1}, selected="8Color")
path_3 = FilePath("C:\GitHub\Alpaca4d\PythonScript\Post-Processing\viewGroundAccAnalyses\viewGroundAccAnalyses.py")  # disabled
file_3 = ReadFile(File=path_3, PerLineParse=False)  # disabled
list_4 = ValueList({"8Color": 0, "20Color": 1}, selected="20Color")  # disabled
panel_9 = Panel("""{
{
{
{""")  # disabled
concatenate = Concatenate(FragmentA=panel_9, FragmentB=item_index)  # disabled
panel_10 = Panel("""}
}
}
}""")  # disabled
panel_11 = Panel("{0}")  # disabled
panel_12 = Panel("{0}")  # disabled
panel_13 = Panel("{0}")  # disabled
concatenate_2 = Concatenate(FragmentA=concatenate, FragmentB=panel_10)  # disabled

# ---- group: Legend Display
number_slider_9 = Slider(10, range=0..10)  # disabled
number_slider_10 = Slider(35, range=0..1000)  # disabled
number_slider_11 = Slider(655, range=0..1000)  # disabled

number_slider_12 = Slider(10, range=0..10)
number_slider_13 = Slider(35, range=0..1000)
number_slider_14 = Slider(655, range=0..1000)

# ----
mesh_plane_2 = MeshPlane(
    Boundary={Plane=PlaneXY(0, 0, 0), Size=Domain2(u=-10..10, v=-10..10)},
    WidthCount=Slider(3, range=0..100),
    HeightCount=Slider(3, range=0..100))  # -> Mesh, Area
number_slider_15 = Slider(3, range=0..100)
subtraction = Subtraction(A=number_slider_15, B="1")
deconstruct_mesh_2 = DeconstructMesh(Mesh=mesh_plane_2.Mesh)  # -> Vertices, Faces, Colours, Normals
series_3 = Series(Start="0", Step="3", Count=number_slider_15)
series_4 = Series(Start="3", Step="3", Count=subtraction)
removeduplicatepts_3 = RemoveDuplicatePts(Points=flatten(deconstruct_mesh_2.Vertices), Tolerance=0.01)
unit_z_4 = UnitZ(Factor=series_3)
unit_z_5 = UnitZ(Factor=series_4)
move_3 = Move(Geometry=graft(removeduplicatepts_3), Motion=unit_z_4)  # -> simplify(Geometry), Transform
move_4 = Move(Geometry=graft(mesh_plane_2.Mesh), Motion=unit_z_5)  # -> Geometry, Transform
shift_list = ShiftList(List=move_3.Geometry, Shift=1, Wrap=True)
deconstruct_mesh_3 = DeconstructMesh(Mesh=move_4.Geometry)  # -> Vertices, Faces, Colours, Normals
removeduplicatepts_4 = RemoveDuplicatePts(Points=flatten(deconstruct_mesh_3.Vertices), Tolerance=0.01)
pdecon_5 = Deconstruct(Point=removeduplicatepts_4)  # -> XComponent, YComponent, ZComponent
larger_than_2 = LargerThan(FirstNumber=pdecon_5.XComponent, SecondNumber="9")  # -> LargerThan, OrEqualTo
mesh_explode = MeshExplode(Mesh=move_4.Geometry, Interpolate=False)
vincoli = Point(removeduplicatepts_3)
cull_5 = CullPattern(List=removeduplicatepts_4, CullPattern=larger_than_2.LargerThan)  # -> flatten(List)
vec_8 = VectorXYZ(XComponent="-100", YComponent=0, ZComponent=0)  # -> Vector, Length
pointload_6 = Point(cull_5)
support_5 = Point(vincoli)

cull_nth = CullNth(List=simplify(shift_list), CullFrequency=number_slider_15)
cull_nth_2 = CullNth(List=simplify(move_3.Geometry), CullFrequency=number_slider_15)
refine = Refine(Mesh=mesh_explode, Level="3")
mesh_explode_2 = MeshExplode(Mesh=refine, Interpolate=False)

line_4 = Line(StartPoint=cull_nth_2, EndPoint=cull_nth)  # -> flatten(Line)
colonne = RemoveDuplicateLines(Lines=line_4, Tolerance=0.01)
entwine_5 = Entwine(
    Branch00=mesh_explode_2,
    Branch01=colonne,
    Branch03=support_5,
    Branch04=pointload_6,
    Branch05=vec_8.Vector,
    FlattenInputs=True)

number_slider_16 = Slider(10, range=0..10)
rectangle = Rectangle(Plane=PlaneXY(0, 0, 0), XSize="10", YSize="20", Radius=0)  # -> Rectangle, Length
mesh_surface = MeshSurface(Surface=rectangle.Rectangle, UCount=number_slider, VCount=number_slider, Overhang=True, Equalize=False)
weaverbird_s_offset_mesh = WeaverbirdsOffsetMesh(MeshCurves=mesh_surface, Distance=graft(series), OffsetType=0)
entwine_6 = Entwine(Branch00=mesh_surface, Branch01=weaverbird_s_offset_mesh, FlattenInputs=True)
subtraction_2 = Subtraction(A="10", B="1")
vec_9 = VectorXYZ(XComponent=0, YComponent=0, ZComponent="-100")  # -> Vector, Length

move_5 = Move(Geometry=mesh_surface, Motion=unit_z_2)  # -> flatten(Geometry), Transform

# ---- group: brith to loft mesh
ghpython_script = GhPythonScript(MeshSeries=move_5.Geometry, color=ColourSwatch(SwatchColor=RGB(4, 0, 255)))  # -> out, simplify(flatten(Brick)); inputs MeshSeries: list of Mesh
# ---------- ghpython_script: Python ----------
import Rhino.Geometry as rg

def MeshToShell(Mesh):
    
    Mesh.Unweld(0, True)
    mesh = Mesh.ExplodeAtUnweldedEdges()
    newMesh = []
    elementType = []
    for explodedMesh in mesh:
        newMesh.append(explodedMesh)
    return newMesh 

def brick( MeshList, color ):
    meshExpl = []
    Vertix = []
    elementType = []
    solid = []
    
    for Mesh in MeshList:
        shellWrapper = MeshToShell(Mesh)
        meshExpl.append( shellWrapper )
    for index1 in range(0, len(MeshList)-1):
        for index2 in range(0, len(meshExpl[0])):
            if meshExpl[ index1 ][ index2 ].Vertices.Count == 4:
                
                elementType.append("stdBrick")
                vertix1 = meshExpl[ index1 ][ index2 ].Vertices[0]
                vertix2 = meshExpl[ index1 ][ index2 ].Vertices[1]
                vertix3 = meshExpl[ index1 ][ index2 ].Vertices[2]
                vertix4 = meshExpl[ index1 ][ index2 ].Vertices[3]
                vertix5 = meshExpl[index1 + 1 ][ index2].Vertices[0]
                vertix6 = meshExpl[index1 + 1 ][ index2].Vertices[1]
                vertix7 = meshExpl[index1 + 1 ][ index2].Vertices[2]
                vertix8 = meshExpl[index1 + 1 ][ index2].Vertices[3]
                
                vertix = [ vertix1, vertix2, vertix3, vertix4,
                vertix5, vertix6, vertix7, vertix8 ]
                
                ele = rg.Mesh()
                
                ele.Vertices.Add( vertix1 ) # 0 
                ele.Vertices.Add( vertix2 ) # 1
                ele.Vertices.Add( vertix3 ) # 2
                ele.Vertices.Add( vertix4 ) # 3
                ele.Vertices.Add( vertix5 ) # 4
                ele.Vertices.Add( vertix6 ) # 5
                ele.Vertices.Add( vertix7 ) # 6
                ele.Vertices.Add( vertix8 ) # 7
                
                ele.VertexColors.Add(color)
                ele.VertexColors.Add(color)
                ele.VertexColors.Add(color)
                ele.VertexColors.Add(color)
                ele.VertexColors.Add(color)
                ele.VertexColors.Add(color)
                ele.VertexColors.Add(color)
                ele.VertexColors.Add(color)
    
                
                ele.Faces.AddFace(0, 1, 2, 3) # 0
                ele.Faces.AddFace(4, 5, 6, 7) # 1
                ele.Faces.AddFace(0, 1, 5, 4) # 2
                ele.Faces.AddFace(3, 2, 6, 7) # 3
                ele.Faces.AddFace(1, 5, 6, 2) # 4
                ele.Faces.AddFace(0, 4, 7, 3) # 5
                #ele.IsClosed()
                
            else :
                elementType.append(["FourNodeTetrahedron"]*3)
                
                if meshExpl[ index1 ][ index2 ].Vertices[0] == meshExpl[index1 + 1 ][ index2].Vertices[0] :
                    vertix1 = meshExpl[ index1 ][ index2 ].Vertices[0]
                    vertix2 = meshExpl[ index1 ][ index2 ].Vertices[1]
                    vertix3 = meshExpl[ index1 ][ index2 ].Vertices[2]
                    vertix4 = meshExpl[index1 + 1 ][ index2].Vertices[1]
                    vertix5 = meshExpl[index1 + 1 ][ index2].Vertices[2]
                    
                    vertixEle1 = [ vertix1, vertix2, vertix3, vertix4 ]
                    vertixEle2 = [ vertix1, vertix2, vertix3, vertix2 ]
                    
                    ele1 = rg.Mesh() # Tetrahedron 1
                    ele2 = rg.Mesh() # Tetrahedron 2
                    
                    ele1.Vertices.Add( vertix1 ) # 0 
                    ele1.Vertices.Add( vertix2 ) # 1
                    ele1.Vertices.Add( vertix3 ) # 2 
                    ele1.Vertices.Add( vertix4 ) # 3 
                    
                    ele1.VertexColors.Add(color)
                    ele1.VertexColors.Add(color)
                    ele1.VertexColors.Add(color)
                    ele1.VertexColors.Add(color)
                    
                    ele2.Vertices.Add( vertix1 ) # 0 
                    ele2.Vertices.Add( vertix2 ) # 1 
                    ele2.Vertices.Add( vertix3 ) # 2 
                    ele2.Vertices.Add( vertix2 ) # 3
    
                    ele2.VertexColors.Add(color)
                    ele2.VertexColors.Add(color)
                    ele2.VertexColors.Add(color)
                    ele2.VertexColors.Add(color)
                    
                    ele1.Faces.AddFace(0, 1, 4 ) # 0
                    ele1.Faces.AddFace(0, 1, 3 ) # 1
                    ele1.Faces.AddFace(0, 4, 3 ) # 2
                    ele1.Faces.AddFace(1, 3, 4 ) # 3
                    
                    ele2.Faces.AddFace(0, 1, 3 ) # 0
                    ele2.Faces.AddFace(0, 1, 2 ) # 1
                    ele2.Faces.AddFace(1, 2, 3 ) # 2
                    ele2.Faces.AddFace(0, 2, 3 ) # 3
                    
                    ele = [ ele1, ele2 ]
                    
                else :
                
                    vertix1 = meshExpl[ index1 ][ index2 ].Vertices[0]
                    vertix2 = meshExpl[ index1 ][ index2 ].Vertices[1]
                    vertix3 = meshExpl[ index1 ][ index2 ].Vertices[2]
                    vertix4 = meshExpl[index1 + 1 ][ index2].Vertices[0]
                    vertix5 = meshExpl[index1 + 1 ][ index2].Vertices[1]
                    vertix6 = meshExpl[index1 + 1 ][ index2].Vertices[2]
                    
                    vertixEle1 = [ vertix1, vertix2, vertix3, vertix6 ]
                    vertixEle2 = [ vertix4, vertix5, vertix6, vertix1 ]
                    vertixEle3 = [ vertix5, vertix6, vertix2, vertix1 ]
                    
                    vertix = [ vertixEle1, vertixEle2, vertixEle3 ]
                    
                    ele1 = rg.Mesh() # Tetrahedron 1
                    ele2 = rg.Mesh() # Tetrahedron 2
                    ele3 = rg.Mesh() # Tetrahedron 3
                    
                    ele1.Vertices.Add( vertix1 ) # 0 
                    ele1.Vertices.Add( vertix2 ) # 1
                    ele1.Vertices.Add( vertix3 ) # 2 
                    ele1.Vertices.Add( vertix6 ) # 3 
                    
                    ele1.VertexColors.Add(color)
                    ele1.VertexColors.Add(color)
                    ele1.VertexColors.Add(color)
                    ele1.VertexColors.Add(color)
                    
                    ele2.Vertices.Add( vertix4 ) # 0 
                    ele2.Vertices.Add( vertix5 ) # 1 
                    ele2.Vertices.Add( vertix6 ) # 2 
                    ele2.Vertices.Add( vertix1 ) # 3
    
                    ele2.VertexColors.Add(color)
                    ele2.VertexColors.Add(color)
                    ele2.VertexColors.Add(color)
                    ele2.VertexColors.Add(color)
                    
                    ele3.Vertices.Add( vertix5 ) # 0 
                    ele3.Vertices.Add( vertix6 ) # 1 
                    ele3.Vertices.Add( vertix2 ) # 2 
                    ele3.Vertices.Add( vertix1 ) # 3
                    
                    ele3.VertexColors.Add(color)
                    ele3.VertexColors.Add(color)
                    ele3.VertexColors.Add(color)
                    ele3.VertexColors.Add(color)
                    
                    ele1.Faces.AddFace(0, 1, 2 ) # 0
                    ele1.Faces.AddFace(0, 3, 1 ) # 1
                    ele1.Faces.AddFace(0, 3, 2 ) # 2
                    ele1.Faces.AddFace(1, 3, 2 ) # 3
                    
                    ele2.Faces.AddFace(0, 1, 2 ) # 0
                    ele2.Faces.AddFace(0, 3, 1 ) # 1
                    ele2.Faces.AddFace(0, 3, 2 ) # 2
                    ele2.Faces.AddFace(1, 3, 2 ) # 3
                    
                    ele3.Faces.AddFace(0, 1, 2 ) # 0
                    ele3.Faces.AddFace(0, 3, 1 ) # 1
                    ele3.Faces.AddFace(0, 3, 2 ) # 2
                    ele3.Faces.AddFace(1, 3, 2 ) # 3
                    
                    ele = [ ele1, ele2, ele3 ]
            
            solid.append(ele)
            Vertix.append( vertix )
    return solid, elementType

Brick, type = brick( MeshSeries, color )
# ---------- end ghpython_script ----------

# ----
move_6 = Move(Geometry=graft(ghpython_script.Brick), Motion=unit_z_3)  # -> flatten(Geometry), Transform

# ----
# Model 0
number_slider_17 = Slider(-20, range=-20..20)
vec_10 = VectorXYZ(XComponent=number_slider_17, YComponent=0, ZComponent=0)  # -> Vector, Length
pointload_7 = Point([Point(0, 0, 10), Point(5, 0, 10), Point(0, 5, 5), Point(0, 5, 10), Point(0, 0, 5)])
vec_11 = VectorXYZ(XComponent=Slider(0, range=-20..20), YComponent=0, ZComponent=0)  # -> Vector, Length
support_6 = Point([Point(0, 0, 0), Point(5, 0, 0), Point(10, 0, 0), Point(15, 0, 0), Point(15, 5, 0), Point(10, 5, 0), Point(5, 5, 0), Point(0, 5, 0)])
shell_2 = Mesh([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])
beam_3 = Curve([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])
truss = Curve([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])
cantiliver = Curve([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])
columns_2 = Curve([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])
vec_12 = VectorXYZ(XComponent=0, YComponent=Slider(11, range=-20..20), ZComponent=0)  # -> Vector, Length
refine_2 = Refine(Mesh=shell_2, Level="2")
mesh_3 = Mesh(refine_2)
clean_2 = CombineClean(Meshes=mesh_3)
explode_3 = MeshExplode(Mesh=clean_2, Interpolate=False)  # -> flatten(Faces)

list_length = ListLength(List=pointload_7)
range = Range(Domain=construct_domain, Steps=list_length)
multiplication = Multiplication(A=vec_6.Vector, B=range)
custom_preview = CustomPreview(Geometry=support_6, Material=ColourSwatch(SwatchColor=RGB(0, 0, 0)))

entwine_7 = Entwine(
    Branch00=explode_3,
    Branch01=beam_3,
    Branch02=truss,
    Branch03=support_6,
    Branch04=pointload_7,
    Branch05=vec_10.Vector,
    Branch06=columns_2,
    Branch07=vec_11.Vector,
    Branch08=cantiliver,
    Branch09=vec_12.Vector,
    Branch010=pointload_7,
    Branch011=multiplication,
    FlattenInputs=True)

# ----
# Model 5
number_slider_18 = Slider(-20, range=-20..20)
vec_13 = VectorXYZ(XComponent=number_slider_18, YComponent=0, ZComponent=0)  # -> Vector, Length
vec_14 = VectorXYZ(XComponent=Slider(0, range=-20..20), YComponent=0, ZComponent=0)  # -> Vector, Length
beam_4 = Curve(curve)
pointload_8 = Point(dispatch_2.ListB)
support_7 = Point(dispatch_2.ListA)

list_length_2 = ListLength(List=pointload_8)
range_2 = Range(Domain=construct_domain_2, Steps=list_length_2)
multiplication_2 = Multiplication(A=vec_7.Vector, B=range_2)

entwine_8 = Entwine(
    Branch01=beam_4,
    Branch03=support_7,
    Branch04=pointload_8,
    Branch05=vec_13.Vector,
    Branch07=vec_14.Vector,
    Branch010=pointload_8,
    Branch011=multiplication_2,
    FlattenInputs=True)

deconstruct_mesh_4 = DeconstructMesh(Mesh=ghpython_script.Brick)  # -> Vertices, Faces, Colours, Normals
ghpython_script_2 = GhPythonScript(x=ghpython_script.Brick)  # -> out, flatten(a); same code as python_2
removeduplicatepts_5 = RemoveDuplicatePts(Points=flatten(deconstruct_mesh_4.Vertices), Tolerance=0.01)
pdecon_6 = Deconstruct(Point=removeduplicatepts_5)  # -> XComponent, YComponent, ZComponent
smaller_3 = SmallerThan(FirstNumber=pdecon_6.XComponent, SecondNumber="0.1")  # -> SmallerThan, OrEqualTo
larger_than_3 = LargerThan(FirstNumber=pdecon_6.XComponent, SecondNumber=subtraction_2)  # -> LargerThan, OrEqualTo
cull_6 = CullPattern(List=removeduplicatepts_5, CullPattern=smaller_3.SmallerThan)  # -> graft(List)
cull_7 = CullPattern(List=removeduplicatepts_5, CullPattern=larger_than_3.LargerThan)  # -> graft(List)
point_4 = Point(cull_7)
pointload_9 = Point(point_4)
support_8 = Point(cull_6)
entwine_9 = Entwine(Branch03=support_8, Branch04=pointload_9, Branch05=vec_9.Vector, Branch012=ghpython_script.Brick, FlattenInputs=True)

dispatch_3 = Dispatch(List=removeduplicatepts_5, DispatchPattern=smaller_3.SmallerThan)  # -> ListA, ListB

point_5 = Point(dispatch_3.ListA)

stream_filter = StreamFilter(
    Gate=list,
    Stream0=entwine_7,
    Stream1=entwine_4,
    Stream2=entwine_3,
    Stream3=entwine_9,
    Stream4=entwine_2,
    Stream5=entwine_8,
    Stream6=entwine,
    Stream7=entwine_5)
explode_tree = ExplodeTree(Data=stream_filter)  # -> Branch0, Branch1, Branch2, Branch3, Branch4, Branch5, Branch6, Branch7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

pointload_10 = Point(explode_tree.Branch4)
vector = Data(explode_tree.Branch5)

support_9 = Point(explode_tree.Branch3)
shell_3 = Mesh(explode_tree.Branch0)
beam_5 = Curve(explode_tree.Branch1)
truss_2 = Curve(explode_tree.Branch2)

data_13 = Data(explode_tree.Branch6)
vector_2 = Data(explode_tree.Branch7)

data_14 = Data(explode_tree.Branch8)
vector_3 = Data(explode_tree.Branch9)

data_15 = Data(explode_tree.Branch10)
mass = Data(explode_tree.Branch11)

brick = Data(explode_tree.Branch12)

# ----
# Support
file_path_13 = FilePath("C:\GitHub\Alpaca4d\PythonScript\Pre-Processing\Element\Support\Support.py")
toggle_2 = BooleanToggle(True)
read_file_13 = ReadFile(File=file_path_13, PerLineParse=False)
point_6 = Point(support_9)
python_12 = GhPythonScript(Code=read_file_13, Pos=graft(point_6), Tx=toggle_2, Ty=Toggle(True), Tz=toggle_2, Rx=toggle_2, Ry=toggle_2, Rz=toggle_2)  # -> Out, flatten(SupportWrapper)
python_13 = GhPythonScript(x=python_12.SupportWrapper)  # -> out, a; same code as python_2
panel_14 = Panel(python_13.a)

# ----
# Linear Load
value_list = ValueList({"LocalAxis": 0, "GlobalAxis": 1}, selected="GlobalAxis")
vector_4 = Vector(vector_2)
crv = Curve(data_13)
python_14 = GhPythonScript(Code=read_file_5, Force=vector_4, Element=crv, Orientation=value_list)  # -> Out, flatten(BeamUniformLoad)

# ----
# Linear Load
value_list_2 = ValueList({"LocalAxis": 0, "GlobalAxis": 1}, selected="GlobalAxis")
vector_5 = Vector(vector_3)
crv_2 = Curve(data_14)
python_15 = GhPythonScript(Code=read_file_5, Force=vector_5, Element=crv_2, Orientation=value_list_2)  # -> Out, flatten(BeamUniformLoad)

# ----
# Point Load
file_path_14 = FilePath("C:\GitHub\Alpaca4d\PythonScript\Pre-Processing\Load\PointLoad.py")
read_file_14 = ReadFile(File=file_path_14, PerLineParse=False)
vector_6 = Vector(expr("x*0", Vector(2.518385542, -6.656153768, 0)))
vector_7 = Vector(vector)
point_7 = Point(pointload_10)
python_16 = GhPythonScript(Code=read_file_14, Force=vector_7, Moment=vector_6, Pos=point_7)  # -> Out, flatten(LoadWrapper)

# ----
# MassLoad
num_2 = Number(mass)
pt_2 = Point(data_15)
path_4 = FilePath("C:\GitHub\Alpaca4d\PythonScript\Pre-Processing\Load\MassLoad.py")
file_4 = ReadFile(File=path_4, PerLineParse=False)
python_17 = GhPythonScript(Code=file_4, NodalMass=num_2, Pos=pt_2)  # -> Out, flatten(Mass)

# ----
# meshToShell
mesh_4 = Mesh(shell_3)
file_path_15 = FilePath("C:\GitHub\Alpaca4d\PythonScript\Pre-Processing\Element\MeshToShell\MeshToShell.py")
read_file_15 = ReadFile(File=file_path_15, PerLineParse=False)
python_18 = GhPythonScript(
    Code=read_file_15,
    Mesh=mesh_4,
    Colour=ColourSwatch(SwatchColor=RGB(0, 72, 255)),
    CrossSection=python_9.PlateFiberSection)  # -> Out, flatten(ShellWrapper)

crv_3 = Curve(truss_2)

# ----
# LineToBeam
file_path_16 = FilePath("C:\GitHub\Alpaca4d\PythonScript\Pre-Processing\Element\LineToBeam\LineToBeam.py")
read_file_16 = ReadFile(File=file_path_16, PerLineParse=False)
list_5 = ValueList({"Truss": 0, "Beam": 1}, selected="Beam")
crv_4 = Curve(beam_5)
python_19 = GhPythonScript(
    Code=read_file_16,
    Line=crv_4,
    Colour=ColourSwatch(SwatchColor=RGB(34, 255, 0)),
    CrossSection=python_10.CrossSection,
    OrientSection="0",
    BeamType=list_5)  # -> Out, flatten(BeamWrapper)

data_16 = Data([python_14.BeamUniformLoad, python_15.BeamUniformLoad, python_16.LoadWrapper])

# ----
# LineToTruss
list_6 = ValueList({"Truss": 0, "Beam": 1}, selected="Truss")
python_20 = GhPythonScript(
    Code=read_file_16,
    Line=crv_3,
    Colour=ColourSwatch(SwatchColor=RGB(255, 200, 0)),
    CrossSection=python_8.CrossSection,
    OrientSection="0",
    BeamType=list_6)  # -> Out, flatten(BeamWrapper)

# ----
# Solid
swatch = ColourSwatch(SwatchColor=RGB(0, 72, 255))
python_21 = GhPythonScript(solid=brick, Colour=swatch, material=python_5.ElasticMaterialWrapper)  # -> out, flatten(SolidWrapper); inputs solid: Mesh
# ---------- python_21: Python ----------
import Rhino.Geometry as rg

def Solid( Mesh, Colour, material):
    
    #Mesh.Unweld(0, True)
    
    #elementType = []
    if Mesh.Vertices.Count == 8:
        elementType = "bbarBrick"
    else:
        elementType = "FourNodeTetrahedron"
    newMesh = Mesh
    
    Material = material
    colour = Colour
    return[ [ newMesh , elementType, Material, colour ] ]

SolidWrapper = Solid( solid, Colour, material )
# ---------- end python_21 ----------

item = ListItem(List=python_21.SolidWrapper, Index=0, Wrap=True)  # -> Item, Item1
python_22 = GhPythonScript(x=item.Item)  # -> out, simplify(a); same code as python_2
python_23 = GhPythonScript(x=python_22.a)  # -> out, simplify(a); same code as python_2
python_24 = GhPythonScript(x=python_23.a)  # -> out, simplify(a); same code as python_2
merge_2 = Merge(Data1=python_18.ShellWrapper, Data2=python_19.BeamWrapper, Data3=python_20.BeamWrapper, Data4=python_21.SolidWrapper)
panel_15 = Panel(python_24.a)
clean_tree = CleanTree(RemoveNulls=True, RemoveInvalid=True, RemoveEmpty=False, Tree=merge_2)
clean_tree_2 = CleanTree(RemoveNulls=True, RemoveInvalid=True, RemoveEmpty=False, Tree=python_12.SupportWrapper)
clean_tree_3 = CleanTree(RemoveNulls=True, RemoveInvalid=True, RemoveEmpty=False, Tree=data_16)
clean_tree_4 = CleanTree(RemoveNulls=True, RemoveInvalid=True, RemoveEmpty=False, Tree=python_17.Mass)

# ----
# Assemble
file_path_17 = FilePath("C:\GitHub\Alpaca4d\PythonScript\Pre-Processing\Assemble\Assemble.py")
read_file_17 = ReadFile(File=file_path_17, PerLineParse=False)
python_25 = GhPythonScript(
    Code=read_file_17,
    Element=flatten(clean_tree),
    Support=flatten(clean_tree_2),
    Load=flatten(clean_tree_3),
    Mass=flatten(clean_tree_4))  # -> Out, OpenSeesModel, MassOfStructure

panel_16 = Panel(python_25.MassOfStructure)  # disabled

# ----
# EarthQuake Analyses
path_5 = FilePath("C:\GitHub\Alpaca4d\PythonScript\Analyses\EarthQuakeAnalysis\BM68elc.acc")  # disabled
panel_17 = Panel("1")  # disabled
path_6 = FilePath("C:\GitHub\Alpaca4d\PythonScript\Analyses\EarthQuakeAnalysis\initializeEarthQuakeAnalysis.py")  # disabled
panel_18 = Panel("0.01")  # disabled
list_7 = ValueList({"x": 1, "y": 2, "z": 3}, selected="z")  # disabled
panel_19 = Panel("5")  # disabled
file_5 = ReadFile(File=path_6, PerLineParse=False)  # disabled
analyze = GhPythonScript(
    Code=file_5,
    OpenSeesModel=python_25.OpenSeesModel,
    TmaxAnalyses=panel_19,
    GroundMotionDirection=list_7,
    GroundMotionValues=path_5,
    GroundMotionTimeStep=panel_18,
    GroundMotionFactor=panel_17,
    TimeStepIncrement=panel_8,
    Damping=0.02,
    NewmarkGamma=0.5,
    NewmarkBeta=0.25)  # -> Out, OpenSeesOutputWrapper, MaxDisplacement, MinDisplacement; disabled

# ----
# modelView
# da fare a cluster
# OK!
file_path_18 = FilePath("C:\GitHub\Alpaca4d\PythonScript\Post-Processing\modelView\modelView.py")  # disabled
toggle_3 = BooleanToggle(False)  # disabled
toggle_4 = BooleanToggle(True)  # disabled
toggle_5 = BooleanToggle(False)  # disabled
toggle_6 = BooleanToggle(True)  # disabled
toggle_7 = BooleanToggle(True)  # disabled
toggle_8 = BooleanToggle(True)  # disabled
read_file_18 = ReadFile(File=file_path_18, PerLineParse=False)  # disabled
python_26 = GhPythonScript(
    Code=read_file_18,
    OpenSeesModel=python_25.OpenSeesModel,
    ModelExstrud=toggle_7,
    Load=toggle_4,
    Support=toggle_6,
    LocalAxes=toggle_8,
    NodeTag=toggle_5,
    ElementTag=toggle_3,
    NodalMass=toggle)  # -> ModelView, LineModel, ForceDisplay, Support, LocalAxis, TagNode, TagEle, Mass; disabled
explode_tree_2 = ExplodeTree(Data=python_26.LocalAxis)  # -> Branch0, Branch1, Branch2, Branch3; disabled
explode_tree_3 = ExplodeTree(Data=python_26.LineModel)  # -> Branch0, Branch1; disabled
number_slider_19 = Slider(3, range=0..10)  # disabled
geo = Geometry(python_26.ModelView)  # disabled
geo_2 = Geometry(geo)  # disabled
explode_tree_4 = ExplodeTree(Data=simplify(python_26.TagNode))  # -> Branch0, Branch1; disabled
explode_tree_5 = ExplodeTree(Data=simplify(python_26.TagEle))  # -> Branch0, Branch1; disabled
explode_tree_6 = ExplodeTree(Data=simplify(python_26.Mass))  # -> Branch0, Branch1; disabled
colour_swatch_2 = ColourSwatch(SwatchColor=RGB(164, 252, 0))  # disabled
colour_swatch_3 = ColourSwatch(SwatchColor=RGB(176, 32, 32))  # disabled
colour_swatch_4 = ColourSwatch(SwatchColor=RGB(107, 106, 102))  # disabled
colour_swatch_5 = ColourSwatch(SwatchColor=RGB(252, 0, 0))  # disabled
explode_tree_7 = ExplodeTree(Data=python_26.ForceDisplay)  # -> Branch0, Branch1; disabled
colour_swatch_6 = ColourSwatch(SwatchColor=RGB(255, 0, 0))  # disabled
colour_swatch_7 = ColourSwatch(SwatchColor=RGB(0, 245, 53))  # disabled
colour_swatch_8 = ColourSwatch(SwatchColor=RGB(0, 55, 255))  # disabled
colour_swatch_9 = ColourSwatch(SwatchColor=RGB(25, 0, 255))  # disabled
curve_direction = GhPythonScript(Crv=explode_tree_3.Branch0, Thickness=number_slider_19, RGB=explode_tree_3.Branch1)  # -> out; inputs Crv: list of Curve, RGB: list of Color; disabled
# ---------- curve_direction: Python ----------
from ghpythonlib.componentbase import executingcomponent as component
import Grasshopper, GhPython
import System
import Rhino as rh
import rhinoscriptsyntax as rs
import Rhino.Geometry as rg


class CurveColor(component):

    def RunScript(self,Crv,Thickness,RGB):
        self.C = Crv
        self.RGB = RGB
        self.t = Thickness
        if not self.C: return
            
    def DrawViewportWires(self,arg):
        if not  self.C: return
        for curve, color in zip( self.C, self.RGB ):
            arg.Display.DrawCurve(curve, color,self.t)
# ---------- end curve_direction ----------
custom_preview_2 = CustomPreview(Geometry=python_26.Support, Material=colour_swatch_2)  # disabled
vector_display_ex = VectorDisplayEx(Point=explode_tree_7.Branch0, Vector=explode_tree_7.Branch1, Colour=colour_swatch_3, Width=2)  # disabled
vector_display_ex_2 = VectorDisplayEx(Point=explode_tree_2.Branch0, Vector=explode_tree_2.Branch1, Colour=colour_swatch_5, Width=2)  # disabled
vector_display_ex_3 = VectorDisplayEx(Point=explode_tree_2.Branch0, Vector=explode_tree_2.Branch2, Colour=colour_swatch_7, Width=2)  # disabled
vector_display_ex_4 = VectorDisplayEx(Point=explode_tree_2.Branch0, Vector=explode_tree_2.Branch3, Colour=colour_swatch_8, Width=2)  # disabled
dot_display = DotDisplay(Point=explode_tree_6.Branch0, Colour=colour_swatch_4, Size=explode_tree_6.Branch1)  # disabled
tag = TextTag(Location=explode_tree_4.Branch0, Text=explode_tree_4.Branch1, Colour=colour_swatch_6)  # disabled
tag_2 = TextTag(Location=explode_tree_5.Branch0, Text=explode_tree_5.Branch1, Colour=colour_swatch_9)  # disabled

file_6 = ReadFile(File=path_5, PerLineParse=False)  # disabled
panel_20 = Panel(" ")  # disabled
split = TextSplit(Text=file_6, Separators=panel_20)  # disabled
panel_21 = Panel("1")  # disabled
division = Division(A=split, B=panel_21)  # disabled
clean_3 = CleanTree(RemoveNulls=True, RemoveInvalid=True, RemoveEmpty=invert(False), Tree=division)  # disabled
graph = QuickGraph(clean_3, SortOrder=0)  # disabled
lng = ListLength(List=clean_3)  # disabled
multiplication_3 = Multiplication(A=lng, B=panel_18)  # disabled
earthquake_file_seconds = Panel(multiplication_3)  # disabled

# ----
# Modal Analyses
path_7 = FilePath("C:\GitHub\Alpaca4d\PythonScript\Analyses\DynamicAnalysis\initializeModalAnalyses.py")
file_7 = ReadFile(File=path_7, PerLineParse=False)
analyze_2 = GhPythonScript(Code=file_7, OpenSeesModel=python_25.OpenSeesModel, NumEigenvalues="12")  # -> Out, OpenSeesOutputWrapper, Frequency, Period; disabled

panel_22 = Panel(analyze_2.Frequency)
analyze_3 = GhPythonScript(Code=file, OpenSeesModel=python_25.OpenSeesModel)  # -> Out, OpenSeesOutputWrapper
analyze_4 = GhPythonScript(Code=file_2, OpenSeesModel=python_25.OpenSeesModel)  # -> Out, OpenSeesOutputWrapper; disabled
panel_23 = Panel(analyze.MinDisplacement)  # disabled
panel_24 = Panel(analyze.MaxDisplacement)  # disabled
merge_3 = Merge(Data1=analyze_3.OpenSeesOutputWrapper, Data2=analyze_4.OpenSeesOutputWrapper)  # -> flatten(Result); disabled
merge_4 = Merge(Data1=analyze_3.OpenSeesOutputWrapper, Data2=analyze_4.OpenSeesOutputWrapper)  # -> flatten(Result); disabled

# ---- group: nD Stress Visualisation
file_path_19 = FilePath("C:\GitHub\Alpaca4d\PythonScript\Post-Processing\shellStressView\shellStressView.py")  # disabled
read_file_19 = ReadFile(File=file_path_19, PerLineParse=False)  # disabled
list_8 = ValueList({"sigmaX": 0, "sigmaY": 1, "sigmaZ": 2, "tauXY": 3, "tauXZ": 4, "tauYZ": 5}, selected="tauYZ")  # disabled
python_27 = GhPythonScript(openSeesOutputWrapper=analyze_4.OpenSeesOutputWrapper, stressView=list_8)  # -> brick, stressValue; inputs openSeesOutputWrapper: list, stressView: Int32; disabled
# ---------- python_27: Python ----------
import Rhino.Geometry as rg
import math as mt
import ghpythonlib.treehelpers as th # per data tree
import Grasshopper
#import System as sy #DV
import sys
import rhinoscriptsyntax as rs
from scriptcontext import doc
fileName = r'C:\GitHub\Alpaca4d\PythonScript\function'
sys.path.append(fileName)
# importante mettere import 'import Rhino.Geometry as rg' prima di importatre DomeFunc
import DomeFunc as dg 
#---------------------------------------------------------------------------------------#
def Solid( ele, node ):
    
    eleTag = ele[0]
    eleNodeTag = ele[1]
    color = ele[2][1]
    #print( eleNodeTag )
    index1 = eleNodeTag[0]
    index2 = eleNodeTag[1]
    index3 = eleNodeTag[2]
    index4 = eleNodeTag[3]
    index5 = eleNodeTag[4]
    index6 = eleNodeTag[5]
    index7 = eleNodeTag[6]
    index8 = eleNodeTag[7]
    
    ## CREO IL MODELLO DEFORMATO  ##
    point1 =  node.get( index1 -1 , "never")
    point2 =  node.get( index2 -1 , "never")
    point3 =  node.get( index3 -1 , "never")
    point4 =  node.get( index4 -1 , "never")
    point5 =  node.get( index5 -1 , "never")
    point6 =  node.get( index6 -1 , "never")
    point7 =  node.get( index7 -1 , "never")
    point8 =  node.get( index8 -1 , "never")
    #print( type(pointDef1) ) 
    shellDefModel = rg.Mesh()
    shellDefModel.Vertices.Add( point1 ) #0
    shellDefModel.Vertices.Add( point2 ) #1
    shellDefModel.Vertices.Add( point3 ) #2
    shellDefModel.Vertices.Add( point4 ) #3
    shellDefModel.Vertices.Add( point5 ) #4
    shellDefModel.Vertices.Add( point6 ) #5
    shellDefModel.Vertices.Add( point7 ) #6
    shellDefModel.Vertices.Add( point8 ) #7

    shellDefModel.Faces.AddFace(0, 1, 2, 3)
    shellDefModel.Faces.AddFace(4, 5, 6, 7)
    shellDefModel.Faces.AddFace(0, 1, 5, 4)
    shellDefModel.Faces.AddFace(1, 2, 6, 5)
    shellDefModel.Faces.AddFace(2, 3, 7, 6)
    shellDefModel.Faces.AddFace(3, 0, 4, 7)
    
    colour = rs.CreateColor( color[0], color[1], color[2] )
    shellDefModel.VertexColors.CreateMonotoneMesh( colour )
    return  shellDefModel

def TetraSolid( ele, node ):
    
    eleTag = ele[0]
    eleNodeTag = ele[1]
    color = ele[2][1]
    #print( eleNodeTag )
    index1 = eleNodeTag[0]
    index2 = eleNodeTag[1]
    index3 = eleNodeTag[2]
    index4 = eleNodeTag[3]
    
    ## CREO IL MODELLO DEFORMATO  ##
    point1 =  node.get( index1 -1 , "never")
    point2 =  node.get( index2 -1 , "never")
    point3 =  node.get( index3 -1 , "never")
    point4 =  node.get( index4 -1 , "never")
    
    #print( type(pointDef1) )
    
    shellDefModel = rg.Mesh()
    shellDefModel.Vertices.Add( point1 ) #0
    shellDefModel.Vertices.Add( point2 ) #1
    shellDefModel.Vertices.Add( point3 ) #2
    shellDefModel.Vertices.Add( point4 ) #3
    
    
    shellDefModel.Faces.AddFace( 0, 1, 2 )
    shellDefModel.Faces.AddFace( 0, 1, 3 )
    shellDefModel.Faces.AddFace( 1, 2, 3 )
    shellDefModel.Faces.AddFace( 0, 2, 3 )
    colour = rs.CreateColor( color[0], color[1], color[2], 0 )
    shellDefModel.VertexColors.CreateMonotoneMesh( colour )
    
    return  shellDefModel

#--------------------------------------------------------------------------
diplacementWrapper = openSeesOutputWrapper[0]
EleOut = openSeesOutputWrapper[2]
#print( ForceOut[0] )
#print( ForceOut[1] )
#nodalForce = openSeesOutputWrapper[5]

#nodalForcerDict = dict( nodalForce )

pointWrapper = []
for index,item in enumerate(diplacementWrapper):
    pointWrapper.append( [index, rg.Point3d(item[0][0],item[0][1],item[0][2]) ] )
## Dict. for point ##
pointWrapperDict = dict( pointWrapper )

EleTag = []
for item in EleOut:
    if  len(item[1])  == 8:
         EleTag.append([item[0], 48])
    elif  len(item[0])  == 'FourNodeTetrahedron':
         EleTag.append([item[0], 24])

## Dict. for force ##
#forceWrapperDict = dict( forceWrapper )
####
#---------------------------------------------------#
outputFile = r'C:\GitHub\Alpaca4d\PythonScript\Analyses\openSees_StaticSolver_3ndf\tension.out'

with open(outputFile, 'r') as f:
    lines = f.readlines()
    tensionList = lines[0].split()

#print(len(tensionList)/len(shellTag))

w = stressView
#print(w + 24)
tensionDic = []
for n,eleTag in enumerate(EleTag) :
    tensionShell = []
    for i in range( (n)*eleTag[1] , ( n + 1 )*eleTag[1]  ):
        tensionShell.append( float(tensionList[i]) )
    if eleTag[1] == 48:
        tensionView = [ tensionShell[ w ], tensionShell[ w + 6 ], tensionShell[ w + 12 ], tensionShell[ w + 18 ], tensionShell[ w + 24 ], tensionShell[ w + 30 ], tensionShell[ w + 36 ], tensionShell[ w + 42 ] ]
    elif eleTag[1] == 24:
        tensionView = [ tensionShell[ w ], tensionShell[ w + 6 ], tensionShell[ w + 12 ], tensionShell[ w + 18 ]]
    tensionDic.append([ eleTag[0], tensionView ])

stressDict = dict( tensionDic )
stressValue = th.list_to_tree( stressDict.values() )
#print( stressDict.get(2))
#print( stressDict )
#print( tensionList[0], tensionList[8], tensionList[16], tensionList[24] )
#print( tensionDic[0] )
'''
maxValue = []
minValue = []
for value in stressDict.values():
    maxValue.append( max( value ))
    minValue.append( min( value ))
    
maxValue = max( maxValue )
minValue = min( minValue )
print( maxValue, minValue )
'''
brick = []
for ele in EleOut :
    eleTag = ele[0]
    eleType = ele[2][0]
    if eleType == "bbarBrick" :
        brickModel = Solid( ele, pointWrapperDict )
        brick.append( brickModel )
    elif eleType == "ShellDKGT" :
        outputForce = forceWrapperDict.get( eleTag )
        tetraModel = ShellTriangle( ele, pointWrapperDict )
        brick.append( tetraModel )
# ---------- end python_27 ----------
bounds_2 = Bounds(Numbers=flatten(python_27.stressValue))  # disabled
deconstruct_domain_2 = DeconstructDomain(Domain=bounds_2)  # -> Start, End; disabled
ghpython_script_3 = GhPythonScript(min=deconstruct_domain_2.Start, max=deconstruct_domain_2.End, value=python_27.stressValue, nColor=list_2)  # -> out, color, tag, domain, colorValue; inputs value: list, nColor: Int32; disabled
# ---------- ghpython_script_3: Python ----------
import Rhino.Geometry as rg
import ghpythonlib.components as ghcomp
import math as mt
import ghpythonlib.treehelpers as th # per data tree
import Grasshopper
#import System as sy #DV
import sys
import rhinoscriptsyntax as rs

'''
ghFilePath = ghenv.LocalScope.ghdoc.Path
ghFileName = ghenv.LocalScope.ghdoc.Name
folderNameLength = len(ghFilePath)-len(ghFileName)-2 #have to remove '.gh'
ghFolderPath = ghFilePath[0:folderNameLength]

outputPath = ghFolderPath + 'assembleData'
wrapperFile = ghFolderPath + 'assembleData\\openSeesModel.txt'

userObjectFolder = Grasshopper.Folders.DefaultUserObjectFolder
fileName = userObjectFolder + 'Alpaca'
'''
fileName = r'C:\GitHub\Alpaca4d\PythonScript\function'
sys.path.append(fileName)
# importante mettere import 'import Rhino.Geometry as rg' prima di importatre DomeFunc
import DomeFunc as dg 
def gradientJet(value, valueMax, valueMin, nColor):
    if nColor == 0:
        listcolo = [rs.CreateColor( 0, 0, 255 ),
                    rs.CreateColor( 0, 128, 255 ),
                    rs.CreateColor( 0, 255, 255 ),
                    rs.CreateColor( 0, 255, 128 ),
                    rs.CreateColor( 128, 255, 0 ),
                    rs.CreateColor( 255, 255, 0 ),
                    rs.CreateColor( 255, 128, 0 ),
                    rs.CreateColor( 204, 0, 0 )]
    elif nColor == 1:
        listcolo = [ rs.CreateColor( 0, 0, 102 ),
                    rs.CreateColor( 0, 0, 255 ),
                    rs.CreateColor( 0, 64, 255 ),
                    rs.CreateColor( 0, 128, 255 ),
                    rs.CreateColor( 0, 191, 255 ),
                    rs.CreateColor( 0, 255, 255 ),
                    rs.CreateColor( 0, 255, 191 ),
                    rs.CreateColor( 0, 255, 128 ),
                    rs.CreateColor( 0, 255, 64 ),
                    rs.CreateColor( 0, 255, 0 ),
                    rs.CreateColor( 64, 255, 0 ),
                    rs.CreateColor( 128, 255, 0 ),
                    rs.CreateColor( 191, 255, 0 ),
                    rs.CreateColor( 255, 255, 0 ),
                    rs.CreateColor( 255, 191, 0 ),
                    rs.CreateColor( 255, 128, 0 ),
                    rs.CreateColor( 255, 64, 0 ),
                    rs.CreateColor( 255, 0, 0 ),
                    rs.CreateColor( 230, 0, 0 ),
                    rs.CreateColor( 204, 0, 0 )]
    #domain = linspace( valueMin,  valueMax, len( listcolo ) )
    n = len( listcolo )
    domain = dg.linspace( valueMin, valueMax, n)
    
    for i in range(1,n):
        if  domain[i-1] <= value <= domain[i]:
            return listcolo[ i ]
        elif  valueMax <= value <= valueMax + 0.00001 :
            return listcolo[ -1 ]
        elif  valueMin - 0.00000000001 <= value <= valueMin  :
            return listcolo[ 0 ]

def gradientJet2(valueMax, valueMin, nColor ):

    if nColor == 0:
        listcolo = [rs.CreateColor( 0, 0, 255 ),
                    rs.CreateColor( 0, 128, 255 ),
                    rs.CreateColor( 0, 255, 255 ),
                    rs.CreateColor( 0, 255, 128 ),
                    rs.CreateColor( 128, 255, 0 ),
                    rs.CreateColor( 255, 255, 0 ),
                    rs.CreateColor( 255, 128, 0 ),
                    rs.CreateColor( 204, 0, 0 )]
    elif nColor == 1:
        listcolo = [ rs.CreateColor( 0, 0, 102 ),
                    rs.CreateColor( 0, 0, 255 ),
                    rs.CreateColor( 0, 64, 255 ),
                    rs.CreateColor( 0, 128, 255 ),
                    rs.CreateColor( 0, 191, 255 ),
                    rs.CreateColor( 0, 255, 255 ),
                    rs.CreateColor( 0, 255, 191 ),
                    rs.CreateColor( 0, 255, 128 ),
                    rs.CreateColor( 0, 255, 64 ),
                    rs.CreateColor( 0, 255, 0 ),
                    rs.CreateColor( 64, 255, 0 ),
                    rs.CreateColor( 128, 255, 0 ),
                    rs.CreateColor( 191, 255, 0 ),
                    rs.CreateColor( 255, 255, 0 ),
                    rs.CreateColor( 255, 191, 0 ),
                    rs.CreateColor( 255, 128, 0 ),
                    rs.CreateColor( 255, 64, 0 ),
                    rs.CreateColor( 255, 0, 0 ),
                    rs.CreateColor( 230, 0, 0 ),
                    rs.CreateColor( 204, 0, 0 )]

    #domain = linspace( valueMin,  valueMax, len( listcolo ) )
    n = len( listcolo )
    diff = (float(valueMax) - valueMin)/( n - 1 )
    domain = [diff * i + valueMin  for i in range(n)]
    return [ listcolo, domain ]

colorList = gradientJet2( max, min, nColor )
color = colorList[0]  #.reverse()
color.reverse()
tag = []
tag.append( str(round(colorList[1][0],2) ) )
for i in range(1,len(colorList[1])):
    tag.append( str(round(colorList[1][i-1],2)) + '< valor < ' + str(round(colorList[1][i],2)) )
domain = colorList[1]
tag.reverse()

colorValue = []
for i in value:
    colorValue.append(gradientJet(i, max, min, nColor))
    print(len(value))
# ---------- end ghpython_script_3 ----------
panel_25 = Panel("{0}")  # disabled
panel_26 = Panel("{0}")  # disabled
panel_27 = Panel("{0}")  # disabled
split_tree = SplitTree(Data=simplify(ghpython_script_3.color), Masks=simplify(panel_25))  # -> Positive, Negative; disabled
split_tree_2 = SplitTree(Data=simplify(ghpython_script_3.tag), Masks=simplify(panel_26))  # -> Positive, Negative; disabled
mesh_colours = MeshColours(Mesh=graft(python_27.brick), Colours=ghpython_script_3.colorValue)  # disabled
split_tree_3 = SplitTree(Data=simplify(ghpython_script_3.domain), Masks=simplify(panel_27))  # -> Positive, Negative; disabled

# ---- group: Shell Stress Visualisation
file_path_20 = FilePath("C:\GitHub\Alpaca4d\PythonScript\Post-Processing\shellStressView\shellStressView.py")
read_file_20 = ReadFile(File=file_path_20, PerLineParse=False)
list_9 = ValueList({"pxx": 0, "pyy": 1, "pxy": 2, "txz": 3, "tyz": 4, "mxx": 5, "myy": 6, "mxy": 7}, selected="pxx")
python_28 = GhPythonScript(Code=read_file_20, OpenSeesOutputWrapper=analyze_3.OpenSeesOutputWrapper, StressView=list_9)  # -> Shell, StressValue
bounds_3 = Bounds(Numbers=flatten(python_28.StressValue))
deconstruct_domain_3 = DeconstructDomain(Domain=bounds_3)  # -> Start, End
ghpython_script_4 = GhPythonScript(min=deconstruct_domain_3.Start, max=deconstruct_domain_3.End, value=python_28.StressValue, nColor=list_3)  # -> out, color, tag, domain, colorValue; inputs value: list, nColor: Int32; same code as ghpython_script_3
split_tree_4 = SplitTree(Data=simplify(ghpython_script_4.color), Masks=simplify("{0}"))  # -> Positive, Negative
split_tree_5 = SplitTree(Data=simplify(ghpython_script_4.tag), Masks=simplify("{0}"))  # -> Positive, Negative
split_tree_6 = SplitTree(Data=simplify(ghpython_script_4.domain), Masks=simplify("{0}"))  # -> Positive, Negative
mesh_colours_2 = MeshColours(Mesh=graft(python_28.Shell), Colours=ghpython_script_4.colorValue)

# ---- group: Beam Forces
number_slider_20 = Slider(10, range=0..10)  # disabled
file_path_21 = FilePath("C:\GitHub\Alpaca4d\PythonScript\Post-Processing\beamForces\beamForces.py")  # disabled
read_file_21 = ReadFile(File=file_path_21, PerLineParse=False)  # disabled
python_29 = GhPythonScript(Code=read_file_21, OpenSeesOutputWrapper=analyze_3.OpenSeesOutputWrapper, NumberResults=number_slider_20)  # -> Out, TagElement, N, V1, V2, Mt, M1, M2; disabled
panel_28 = Panel(python_29.N)  # disabled

# ---- group: Reaction Forces
file_path_22 = FilePath("C:\GitHub\Alpaca4d\PythonScript\Post-Processing\reaction\reaction.py")  # disabled
toggle_9 = BooleanToggle(True)  # disabled
toggle_10 = BooleanToggle(True)  # disabled
read_file_22 = ReadFile(File=file_path_22, PerLineParse=False)  # disabled
python_30 = GhPythonScript(
    Code=read_file_22,
    OpenSeesOutputWrapper=analyze_3.OpenSeesOutputWrapper,
    ReactionForcesView=toggle_10,
    ReactionMomentsView=toggle_9,
    Scale=number_slider_7)  # -> Out, TagPoints, ReactionForce, ReactionMoment, View; disabled
reactionforce = ReactionForce(python_30.ReactionForce)  # disabled
tagpoints = TagPoints(python_30.TagPoints)  # disabled
reactionmoment = ReactionMoment(python_30.ReactionMoment)  # disabled
explode_tree_8 = ExplodeTree(Data=python_30.View)  # -> Branch0, Branch1, Branch2, Branch3, Branch4, Branch5, Branch6; disabled

# ---- group: shell Forces
file_path_23 = FilePath("C:\GitHub\Alpaca4d\PythonScript\Post-Processing\shellForces\shellForces.py")  # disabled
read_file_23 = ReadFile(File=file_path_23, PerLineParse=False)  # disabled
python_31 = GhPythonScript(Code=read_file_23, OpenSeesOutputWrapper=analyze_3.OpenSeesOutputWrapper)  # -> Out, TagElement, Fx, Fy, Fz, Mx, My, Mz; disabled
panel_29 = Panel(python_31.Mz)  # disabled

# ---- group: shell Force Visualisation
file_path_24 = FilePath("C:\GitHub\Alpaca4d\PythonScript\Post-Processing\shellForceView\shellForceView.py")  # disabled
read_file_24 = ReadFile(File=file_path_24, PerLineParse=False)  # disabled
list_10 = ValueList({"Fx": 0, "Fy": 1, "Fz": 2, "Mx": 3, "My": 4, "Mz": 5}, selected="Mz")  # disabled
python_32 = GhPythonScript(Code=read_file_24, OpenSeesOutputWrapper=analyze_3.OpenSeesOutputWrapper, ViewForce=list_10)  # -> ModelForce, ForceValue; disabled

# ---- group: Cds Visualisation
number_slider_21 = Slider(0.675, range=0.001..10)  # disabled
file_path_25 = FilePath("C:\GitHub\Alpaca4d\PythonScript\Post-Processing\cdsView\cdsView.py")  # disabled
read_file_25 = ReadFile(File=file_path_25, PerLineParse=False)  # disabled
list_11 = ValueList({"N": 0, "V1": 1, "V2": 2, "M2": 3, "M1": 4, "Mt": 5}, selected="Mt")  # disabled
python_33 = GhPythonScript(Code=read_file_25, OpenSeesOutputWrapper=analyze_3.OpenSeesOutputWrapper, Cds=list_11)  # disabled

# ----
# deformedModelView
# OK!
file_path_26 = FilePath("C:\GitHub\Alpaca4d\PythonScript\Post-Processing\defModelView\defModelView.py")  # disabled
read_file_26 = ReadFile(File=file_path_26, PerLineParse=False)  # disabled
toggle_11 = BooleanToggle(False)  # disabled
list_12 = ValueList({"tx": 0, "ty": 1, "tz": 2}, selected="tz")  # disabled
python_34 = GhPythonScript(Code=read_file_26, OpenSeesOutputWrapper=merge_4, Direction=list_12, Scale=number_slider_6, ModelExstrud=toggle_11)  # -> Out, ModelDisp, ModelCurve, Max_min; disabled
modeldisp = ModelDisp(python_34.ModelDisp)  # disabled
max_min = Max_min(python_34.Max_min)  # disabled
explode_tree_9 = ExplodeTree(Data=python_34.ModelCurve)  # -> Branch0, Branch1, Branch2; disabled
list_item = ListItem(List=python_34.Max_min, Index=0, Wrap=True)  # -> Item, Item1; disabled
divide_curve = DivideCurve(Curve=explode_tree_9.Branch0, Count=explode_tree_9.Branch1, Kinks=False)  # -> Points, Tangents, simplify(Parameters); disabled
construct_domain_3 = ConstructDomain(DomainStart=list_item.Item1, DomainEnd=list_item.Item)  # disabled
dedomain = DeconstructDomain(Domain=construct_domain_3)  # -> Start, End; disabled
number_slider_22 = Slider(3, range=0..10)  # disabled
shatter = Shatter(Curve=graft(explode_tree_9.Branch0), Parameters=divide_curve.Parameters)  # -> simplify(Segments); disabled
ghpython_script_5 = GhPythonScript(max=dedomain.End, min=dedomain.Start)  # -> out, color, tag, domain; disabled
# ---------- ghpython_script_5: Python ----------
import Rhino.Geometry as rg
import ghpythonlib.components as ghcomp
import math as mt
import ghpythonlib.treehelpers as th # per data tree
import Grasshopper
#import System as sy #DV
import sys
import rhinoscriptsyntax as rs

'''
ghFilePath = ghenv.LocalScope.ghdoc.Path
ghFileName = ghenv.LocalScope.ghdoc.Name
folderNameLength = len(ghFilePath)-len(ghFileName)-2 #have to remove '.gh'
ghFolderPath = ghFilePath[0:folderNameLength]

outputPath = ghFolderPath + 'assembleData'
wrapperFile = ghFolderPath + 'assembleData\\openSeesModel.txt'

userObjectFolder = Grasshopper.Folders.DefaultUserObjectFolder
fileName = userObjectFolder + 'Alpaca'
'''
fileName = r'C:\GitHub\Alpaca4d\PythonScript\function'
sys.path.append(fileName)

def gradientJet2(value, valueMax, valueMin):

    listcolo = [ rs.CreateColor( 0, 0, 102 ),
                rs.CreateColor( 0, 0, 255 ),
                rs.CreateColor( 0, 64, 255 ),
                rs.CreateColor( 0, 128, 255 ),
                rs.CreateColor( 0, 191, 255 ),
                rs.CreateColor( 0, 255, 255 ),
                rs.CreateColor( 0, 255, 191 ),
                rs.CreateColor( 0, 255, 128 ),
                rs.CreateColor( 0, 255, 64 ),
                rs.CreateColor( 0, 255, 0 ),
                rs.CreateColor( 64, 255, 0 ),
                rs.CreateColor( 128, 255, 0 ),
                rs.CreateColor( 191, 255, 0 ),
                rs.CreateColor( 255, 255, 0 ),
                rs.CreateColor( 255, 191, 0 ),
                rs.CreateColor( 255, 128, 0 ),
                rs.CreateColor( 255, 64, 0 ),
                rs.CreateColor( 255, 0, 0 ),
                rs.CreateColor( 230, 0, 0 ),
                rs.CreateColor( 204, 0, 0 )]

    #domain = linspace( valueMin,  valueMax, len( listcolo ) )
    n = len( listcolo )
    diff = (float(valueMax) - valueMin)/( n - 1 )
    domain = [diff * i + valueMin  for i in range(n)]
    return [ listcolo, domain ]


colorList = gradientJet2( value, max, min )
color = colorList[0]  #.reverse()
color.reverse()
tag = []
tag.append( str(round(colorList[1][0],2) ) )
for i in range(1,len(colorList[1])):
    tag.append( str(round(colorList[1][i-1],2)) + '< valor < ' + str(round(colorList[1][i],2)) )
domain = colorList[1]
tag.reverse()
# ---------- end ghpython_script_5 ----------
curve_direction_2 = GhPythonScript(Crv=flatten(shatter), Thickness=number_slider_22, RGB=explode_tree_9.Branch2)  # -> out; inputs Crv: list of Curve, RGB: list of Color; disabled; same code as curve_direction
number_slider_23 = Slider(40, range=0..100)  # disabled
number_slider_24 = Slider(2, range=0..10)  # disabled
lng_2 = ListLength(List=ghpython_script_5.domain)  # disabled
planesrf = PlaneSurface(Plane=PlaneXY(0, 0, 0), XSize=number_slider_23, YSize=number_slider_24)  # disabled
divide = DivideDomain²(Domain=planesrf, UCount=lng_2, VCount=1)  # disabled
subsrf = Isotrim(Surface=planesrf, Domain=divide)  # disabled
mcol = MeshColours(Mesh=graft(subsrf), Colours=graft(ghpython_script_5.color))  # disabled
mjoin = MeshJoin(Meshes=flatten(mcol))  # disabled
pt_3 = ConstructPoint(XCoordinate=number_slider_11, YCoordinate=number_slider_10, ZCoordinate=0)  # disabled
M = Mesh(mjoin)  # disabled
render_mesh_to_screen = RenderMeshToScreen(Mesh=mjoin, Location=pt_3, ScaleFactor=number_slider_9, Depth=0.95, Fixed=True, m_scWithvp=False)  # disabled

# ----
# we can skip some data point. We don't need to read all of them. This can help to make it faster.
# 
# OR
# 
# We can read ALL the files and show only some output.
number_of_line_to_skip = Slider(90, range=1..100)  # disabled
number_slider_25 = Slider(25, range=0..1000)  # disabled
toggle_12 = BooleanToggle(True)  # disabled
button = Button()  # disabled
toggle_13 = BooleanToggle(False)  # disabled
list_13 = ValueList({"tx": 0, "ty": 1, "tz": 2}, selected="ty")  # disabled
ghpython_script_6 = GhPythonScript(
    Code=file_3,
    OpenSeesOutputWrapper=analyze.OpenSeesOutputWrapper,
    Speed=number_of_line_to_skip,
    Animate=toggle_13,
    Reset=button,
    Scale=number_slider_25,
    Direction=list_13,
    ModelExstrud=toggle_12)  # -> Out, ModelDisp, ModelCurve, Trans, Rot; disabled
modeldisp_2 = ModelDisp(ghpython_script_6.ModelDisp)  # disabled
explode_tree_10 = ExplodeTree(Data=ghpython_script_6.ModelCurve)  # -> Branch0, Branch1, Branch2; disabled
divide_curve_2 = DivideCurve(Curve=explode_tree_10.Branch0, Count=explode_tree_10.Branch1, Kinks=False)  # -> Points, Tangents, simplify(Parameters); disabled
number_slider_26 = Slider(3, range=0..10)  # disabled
shatter_2 = Shatter(Curve=graft(explode_tree_10.Branch0), Parameters=divide_curve_2.Parameters)  # -> simplify(Segments); disabled
curve_direction_3 = GhPythonScript(Crv=flatten(shatter_2), Thickness=number_slider_26, RGB=explode_tree_10.Branch2)  # -> out; inputs Crv: list of Curve, RGB: list of Color; disabled; same code as curve_direction

# ---- group: brick Displacement
python_35 = GhPythonScript(Code=read_file_12, OpenSeesOutputWrapper=analyze_4.OpenSeesOutputWrapper)  # -> Out, TagElement, Trans; disabled

# ---- group: Shell Displacement
python_36 = GhPythonScript(Code=read_file_10, OpenSeesOutputWrapper=analyze_3.OpenSeesOutputWrapper)  # -> Out, TagElement, Trans, Rot; disabled

# ---- group: Beam Displacement
python_37 = GhPythonScript(Code=read_file_9, OpenSeesOutputWrapper=analyze_3.OpenSeesOutputWrapper, NumberResults=number_slider_8)  # -> Out, TagElement, LocalTrans, LocalRot, GlobalTrans, GlobalRot; disabled

# ---- group: Displacement Nodes
python_38 = GhPythonScript(Code=read_file_11, OpenSeesOutputWrapper=merge_3)  # -> Out, Points, Trans, Rot; disabled

# ----
devec = DeconstructVector(Vector=ghpython_script_6.Trans)  # -> XComponent, YComponent, ZComponent; disabled

# ----
# Force component
colour_swatch_10 = ColourSwatch(SwatchColor=RGB(252, 0, 0))  # disabled
colour_swatch_11 = ColourSwatch(SwatchColor=RGB(0, 55, 255))  # disabled
vector_display_ex_5 = VectorDisplayEx(
    Point=explode_tree_8.Branch0,
    Vector=[explode_tree_8.Branch3, explode_tree_8.Branch2, explode_tree_8.Branch1],
    Colour=colour_swatch_10,
    Width=2)  # disabled
vector_display_ex_6 = VectorDisplayEx(
    Point=explode_tree_8.Branch0,
    Vector=[explode_tree_8.Branch6, explode_tree_8.Branch5, explode_tree_8.Branch4],
    Colour=colour_swatch_11,
    Width=2)  # disabled

graph_2 = QuickGraph([devec.XComponent, devec.YComponent, devec.ZComponent], SortOrder=0)  # disabled
bounds_4 = Bounds(Numbers=flatten(python_38.Trans))  # disabled
deconstruct_domain_4 = DeconstructDomain(Domain=bounds_4)  # -> Start, End; disabled
vector_length = VectorLength(Vector=python_38.Trans)  # disabled
positive = Positive(split_tree_5.Positive)  # disabled
shell_4 = Shell(python_28.Shell)  # disabled
stressvalue = StressValue(python_28.StressValue)  # disabled
mesh_5 = Mesh(mesh_colours_2)  # disabled
positive_2 = Positive(split_tree_4.Positive)  # disabled
ghpython_script_7 = GhPythonScript(min=deconstruct_domain_4.Start, max=deconstruct_domain_4.End, value=vector_length, nColor=list_4)  # -> out, color, tag, domain, colorValue; inputs value: list, nColor: Int32; disabled; same code as ghpython_script_3
mesh_spray = MeshSpray(Mesh=python_34.ModelDisp, Points=python_38.Points, Colours=ghpython_script_7.colorValue, SprayMode=11)  # disabled
split_tree_7 = SplitTree(Data=simplify(ghpython_script_7.color), Masks=simplify(panel_11))  # -> Positive, Negative; disabled
split_tree_8 = SplitTree(Data=simplify(ghpython_script_7.tag), Masks=simplify(panel_12))  # -> Positive, Negative; disabled
split_tree_9 = SplitTree(Data=simplify(ghpython_script_7.domain), Masks=simplify(panel_13))  # -> Positive, Negative; disabled
split_tree_10 = SplitTree(Data=simplify(python_32.ForceValue), Masks=simplify(concatenate_2))  # -> Positive, Negative; disabled
cull_index = CullIndex(List=python_32.ModelForce, Indices=item_index, Wrap=True)  # disabled
bounds_5 = Bounds(Numbers=flatten(python_32.ForceValue))  # disabled
bounds_6 = Bounds(Numbers=flatten(split_tree_10.Negative))  # disabled
deconstruct_domain_5 = DeconstructDomain(Domain=bounds_5)  # -> Start, End; disabled
deconstruct_domain_6 = DeconstructDomain(Domain=bounds_6)  # -> Start, End; disabled
panel_30 = Panel(deconstruct_domain_5.Start)  # disabled
panel_31 = Panel(deconstruct_domain_5.End)  # disabled
ghpython_script_8 = GhPythonScript(min=deconstruct_domain_6.Start, max=deconstruct_domain_6.End, value=split_tree_10.Negative)  # -> out, color, tag, domain, colorValue; inputs value: list; disabled
# ---------- ghpython_script_8: Python ----------
import Rhino.Geometry as rg
import ghpythonlib.components as ghcomp
import math as mt
import ghpythonlib.treehelpers as th # per data tree
import Grasshopper
#import System as sy #DV
import sys
import rhinoscriptsyntax as rs

'''
ghFilePath = ghenv.LocalScope.ghdoc.Path
ghFileName = ghenv.LocalScope.ghdoc.Name
folderNameLength = len(ghFilePath)-len(ghFileName)-2 #have to remove '.gh'
ghFolderPath = ghFilePath[0:folderNameLength]

outputPath = ghFolderPath + 'assembleData'
wrapperFile = ghFolderPath + 'assembleData\\openSeesModel.txt'

userObjectFolder = Grasshopper.Folders.DefaultUserObjectFolder
fileName = userObjectFolder + 'Alpaca'
'''
fileName = r'C:\GitHub\Alpaca4d\PythonScript\function'
sys.path.append(fileName)
# importante mettere import 'import Rhino.Geometry as rg' prima di importatre DomeFunc
import DomeFunc as dg 
def gradientJet(value, valueMax, valueMin):

    listcolo = [ rs.CreateColor( 0, 0, 102 ),
                rs.CreateColor( 0, 0, 255 ),
                rs.CreateColor( 0, 64, 255 ),
                rs.CreateColor( 0, 128, 255 ),
                rs.CreateColor( 0, 191, 255 ),
                rs.CreateColor( 0, 255, 255 ),
                rs.CreateColor( 0, 255, 191 ),
                rs.CreateColor( 0, 255, 128 ),
                rs.CreateColor( 0, 255, 64 ),
                rs.CreateColor( 0, 255, 0 ),
                rs.CreateColor( 64, 255, 0 ),
                rs.CreateColor( 128, 255, 0 ),
                rs.CreateColor( 191, 255, 0 ),
                rs.CreateColor( 255, 255, 0 ),
                rs.CreateColor( 255, 191, 0 ),
                rs.CreateColor( 255, 128, 0 ),
                rs.CreateColor( 255, 64, 0 ),
                rs.CreateColor( 255, 0, 0 ),
                rs.CreateColor( 230, 0, 0 ),
                rs.CreateColor( 204, 0, 0 )]

    #domain = linspace( valueMin,  valueMax, len( listcolo ) )
    n = len( listcolo )
    domain = dg.linspace( valueMin, valueMax, n)
    
    for i in range(1,n):
        if  domain[i-1] <= value <= domain[i]:
            return listcolo[ i ]
        elif  valueMax <= value <= valueMax + 0.00001 :
            return listcolo[ -1 ]
        elif  valueMin - 0.00000000001 <= value <= valueMin  :
            return listcolo[ 0 ]

def gradientJet2(valueMax, valueMin):

    listcolo = [ rs.CreateColor( 0, 0, 102 ),
                rs.CreateColor( 0, 0, 255 ),
                rs.CreateColor( 0, 64, 255 ),
                rs.CreateColor( 0, 128, 255 ),
                rs.CreateColor( 0, 191, 255 ),
                rs.CreateColor( 0, 255, 255 ),
                rs.CreateColor( 0, 255, 191 ),
                rs.CreateColor( 0, 255, 128 ),
                rs.CreateColor( 0, 255, 64 ),
                rs.CreateColor( 0, 255, 0 ),
                rs.CreateColor( 64, 255, 0 ),
                rs.CreateColor( 128, 255, 0 ),
                rs.CreateColor( 191, 255, 0 ),
                rs.CreateColor( 255, 255, 0 ),
                rs.CreateColor( 255, 191, 0 ),
                rs.CreateColor( 255, 128, 0 ),
                rs.CreateColor( 255, 64, 0 ),
                rs.CreateColor( 255, 0, 0 ),
                rs.CreateColor( 230, 0, 0 ),
                rs.CreateColor( 204, 0, 0 )]

    #domain = linspace( valueMin,  valueMax, len( listcolo ) )
    n = len( listcolo )
    diff = (float(valueMax) - valueMin)/( n - 1 )
    domain = [diff * i + valueMin  for i in range(n)]
    return [ listcolo, domain ]


colorList = gradientJet2( max, min )
color = colorList[0]  #.reverse()
color.reverse()
tag = []
tag.append( str(round(colorList[1][0],2) ) )
for i in range(1,len(colorList[1])):
    tag.append( str(round(colorList[1][i-1],2)) + '< valor < ' + str(round(colorList[1][i],2)) )
domain = colorList[1]
tag.reverse()

colorValue = []
for i in value:
    colorValue.append(gradientJet(i, max, min))
    print(len(value))
# ---------- end ghpython_script_8 ----------
mesh_colours_3 = MeshColours(Mesh=graft(cull_index), Colours=ghpython_script_8.colorValue)  # disabled

# ----
# OK!
file_path_27 = FilePath("C:\GitHub\Alpaca4d\PythonScript\Post-Processing\disassembleModel\disassembleModel.py")
read_file_27 = ReadFile(File=file_path_27, PerLineParse=False)

# ---- group: disassemble Model
python_39 = GhPythonScript(Code=read_file_27, OpenSeesModel=python_25.OpenSeesModel)  # -> ModelView, ModelViewExtruded, Points, Support, Load, Material, Section

# ----
panel_32 = Panel(python_39.ModelViewExtruded)

# ----
# Modal Animate
number_slider_27 = Slider(7, range=0..10)
path_8 = FilePath("C:\GitHub\Alpaca4d\PythonScript\Post-Processing\animateModal\animateModal.py")
list_14 = ValueList({"tx": 0, "ty": 1, "tz": 2}, selected="tx")
file_8 = ReadFile(File=path_8, PerLineParse=False)
planesrf_2 = PlaneSurface(Plane=PlaneXY(0, 0, 0), XSize=Slider(40, range=0..100), YSize=Slider(2, range=0..10))
pt_4 = ConstructPoint(XCoordinate=number_slider_14, YCoordinate=number_slider_13, ZCoordinate=0)

# ---- group: MODAL ANALYSIS
ghpython_script_9 = GhPythonScript(
    Code=file_8,
    OpenSeesOutputWrapper=analyze_2.OpenSeesOutputWrapper,
    NumberMode=Slider(2, range=0..10),
    Speed=Slider(1, range=1..50),
    Animate=Toggle(False),
    Reset=Button(),
    Scale=number_slider_27,
    Direction=list_14,
    ModelExstrud=Toggle(True))  # -> Out, ModelDisp, ModelCurve, Max_min

# ----
list_item_2 = ListItem(List=ghpython_script_9.Max_min, Index=0, Wrap=True)  # -> Item, Item1
modeldisp_3 = ModelDisp(ghpython_script_9.ModelDisp)
max_min_2 = Max_min(ghpython_script_9.Max_min)
explode_tree_11 = ExplodeTree(Data=ghpython_script_9.ModelCurve)  # -> Branch0, Branch1, Branch2
construct_domain_4 = ConstructDomain(DomainStart=list_item_2.Item1, DomainEnd=list_item_2.Item)
divide_curve_3 = DivideCurve(Curve=explode_tree_11.Branch0, Count=explode_tree_11.Branch1, Kinks=False)  # -> Points, Tangents, simplify(Parameters)
dedomain_2 = DeconstructDomain(Domain=construct_domain_4)  # -> Start, End
shatter_3 = Shatter(Curve=graft(explode_tree_11.Branch0), Parameters=divide_curve_3.Parameters)  # -> simplify(Segments)
ghpython_script_10 = GhPythonScript(max=dedomain_2.End, min=dedomain_2.Start)  # -> out, color, tag, domain; same code as ghpython_script_5
curve_direction_4 = GhPythonScript(Crv=flatten(shatter_3), Thickness=Slider(3, range=0..10), RGB=explode_tree_11.Branch2)  # -> out; inputs Crv: list of Curve, RGB: list of Color; same code as curve_direction
lng_3 = ListLength(List=ghpython_script_10.domain)
divide_2 = DivideDomain²(Domain=planesrf_2, UCount=lng_3, VCount=1)
subsrf_2 = Isotrim(Surface=planesrf_2, Domain=divide_2)
mcol_2 = MeshColours(Mesh=graft(subsrf_2), Colours=graft(ghpython_script_10.color))
mjoin_2 = MeshJoin(Meshes=flatten(mcol_2))
M_2 = Mesh(mjoin_2)
render_mesh_to_screen_2 = RenderMeshToScreen(Mesh=mjoin_2, Location=pt_4, ScaleFactor=number_slider_12, Depth=0.95, Fixed=True, m_scWithvp=False)
