# Grasshopper definition DebugVisualisation.gh (Grasshopper 1.0.7)

# ---- group: Element
data = Data(0)
data_2 = Data(0)

# ---- group: Load
data_3 = Data(0)
data_4 = Data(0)

# ---- group: Cross-Section
data_5 = Data(0)
data_6 = Data(0)

# ---- group: Support
data_7 = Data(0)
data_8 = Data(0)

# ---- group: Material
data_9 = Data(0)
data_10 = Data(0)

# ---- group: Constraint
data_11 = Data(0)
data_12 = Data(0)

# ----
data_13 = Data(Tree({0;0}: [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], {0;1}: [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], {0;2}: [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], {0;3}: [Point(0, 0, 0), Point(5, 0, 0), Point(10, 0, 0), Point(15, 0, 0), Point(15, 5, 0), Point(10, 5, 0), Point(5, 5, 0), Point(0, 5, 0)], {0;4}: [Point(0, 0, 10), Point(5, 0, 10), Point(0, 5, 5), Point(0, 5, 10), Point(0, 0, 5)], {0;5}: [Vector(0, 0, 10)], {0;6}: [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], {0;7}: [Vector(0, 0, 0)], {0;8}: [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], {0;9}: [Vector(0, 11, 0)], {0;10}: [Point(0, 0, 10), Point(5, 0, 10), Point(0, 5, 5), Point(0, 5, 10), Point(0, 0, 5)], {0;11}: [Vector(11, 11, 0), Vector(26.4, 26.4, 0), Vector(41.8, 41.8, 0), Vector(57.2, 57.2, 0), Vector(72.6, 72.6, 0), Vector(88, 88, 0)]))
explode_tree = ExplodeTree(Data=data_13)  # -> Branch0, Branch1, Branch2, Branch3, Branch4, Branch5, Branch6, Branch7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

pointload = Point(explode_tree.Branch4)
vector = Data(explode_tree.Branch5)

truss = Curve(explode_tree.Branch2)
support = Point(explode_tree.Branch3)

vector_2 = Data(explode_tree.Branch7)
data_14 = Data(explode_tree.Branch6)

data_15 = Data(explode_tree.Branch8)
vector_3 = Data(explode_tree.Branch9)

shell = Mesh(explode_tree.Branch0)
beam = Curve(explode_tree.Branch1)

data_16 = Data(explode_tree.Branch10)
mass = Data(explode_tree.Branch11)

brick = Data(explode_tree.Branch12)

# ----
# UniaxialMaterial
# Elastic
panel = Panel("210000")
ghpython_script = GhPythonScript(matName="S255", E=panel, G="80760", rho="75", fy="25")  # -> out, uniaxialMaterial
# ---------- ghpython_script: Python ----------
"""Generate a uniaxial Elastic Material
    Inputs:
        matName: Name of the material.
        E: Young's Modulus [MPa].
        G: Tangential Modulus [MPa].
        v: Poisson ratio.
        rho: specific weight [kN/m3].
        fy: Yield stress value of the material [MPa]
    Output:
       uniaxialMaterial: Material element.
       """


import Grasshopper as gh

def ElasticMaterial(matName, E, G, v, rho, fy):

    E = E * 1000                               # Input value in N/mm2 ---> Output kN/m2
    if v == None:
    	G = G * 1000                           # Input value in N/mm2 ---> Output kN/m2
    	v = (E / (2 * G)) - 1
    else:
    	G = E / (2 * (1 + v))

    rho = rho                                  # Input value kN/m3
    
    fy = fy                                    # Input value in N/mm2
    materialDimension = "uniaxialMaterial"
    materialType = "Elastic"
    matName = matName + "_" + materialDimension + "_" + materialType
    
    return [[matName, E, G, v, rho, fy, materialType]]

checkData = True

if matName is None:
    checkData = False
    msg = "input 'matName' failed to collect data"
    ghenv.Component.AddRuntimeMessage(gh.Kernel.GH_RuntimeMessageLevel.Warning, msg)

if E is None:
    checkData = False
    msg = "input 'E' failed to collect data"
    ghenv.Component.AddRuntimeMessage(gh.Kernel.GH_RuntimeMessageLevel.Warning, msg)

if G is None and v is None:
    checkData = False
    msg = "input 'G' or 'v' failed to collect data"
    ghenv.Component.AddRuntimeMessage(gh.Kernel.GH_RuntimeMessageLevel.Warning, msg)


if rho is None:
    checkData = False
    msg = "input 'rho' failed to collect data"
    ghenv.Component.AddRuntimeMessage(gh.Kernel.GH_RuntimeMessageLevel.Warning, msg)


if checkData != False:
    uniaxialMaterial = ElasticMaterial(matName, E, G, v, rho, fy)
# ---------- end ghpython_script ----------
ghpython_script_2 = GhPythonScript(x=ghpython_script.uniaxialMaterial)  # -> out, a
# ---------- ghpython_script_2: Python ----------
a = x
# ---------- end ghpython_script_2 ----------
panel_2 = Panel(ghpython_script_2.a)

# ----
# Support
file_path = FilePath("C:\GitHub\Alpaca4d\PythonScript\Pre-Processing\Element\Support\Support.py")
boolean_toggle = BooleanToggle(True)
read_file = ReadFile(File=file_path, PerLineParse=False)
point = Point(support)
ghpython_script_3 = GhPythonScript(
    Pos=graft(point),
    Tx=boolean_toggle,
    Ty=Toggle(True),
    Tz=boolean_toggle,
    Rx=boolean_toggle,
    Ry=boolean_toggle,
    Rz=boolean_toggle)  # -> out, flatten(supportWrapper); inputs Pos: Point3d, Tx: Int32, Ty: Int32, Tz: Int32, Rx: Int32, Ry: Int32, Rz: Int32
# ---------- ghpython_script_3: Python ----------
"""Generate support for the structure.
    Inputs:
        Pos: QuadMesh representing the structural element.
        Tx: Translation in X. TRUE if it is Fixed.
        Ty: Translation in Y. TRUE if it is Fixed.
        Tz: Translation in Z. TRUE if it is Fixed.
        Rx: Rotation about the X axis. TRUE if it is Fixed.
        Ry: Rotation about the Y axis. TRUE if it is Fixed.
        Rz: Rotation about the Z axis. TRUE if it is Fixed.
    Output:
       supportWrapper: Point with constraint properties.
       """

import Grasshopper as gh


def SupportWrapper(Pos, Tx, Ty, Tz, Rx, Ry, Rz):

    Pos = Pos

    Tx = int(False) if Tx is None else Tx
    Ty = int(False) if Ty is None else Ty
    Tz = int(False) if Tz is None else Tz
    Rx = int(False) if Rx is None else Rx
    Ry = int(False) if Ry is None else Ry
    Rz = int(False) if Rz is None else Rz

    return [[Pos, Tx, Ty, Tz, Rx, Ry, Rz]]

checkData = True

if Pos is None:
    checkData = False
    msg = "input 'Pos' failed to collect data"
    ghenv.Component.AddRuntimeMessage(gh.Kernel.GH_RuntimeMessageLevel.Warning, msg)


if checkData != False:
    supportWrapper = SupportWrapper(Pos, Tx, Ty, Tz, Rx, Ry, Rz)
# ---------- end ghpython_script_3 ----------
ghpython_script_4 = GhPythonScript(x=ghpython_script_3.supportWrapper)  # -> out, a; same code as ghpython_script_2
panel_3 = Panel(ghpython_script_4.a)

# ----
# nDMaterial
# ElasticIsotropic
panel_4 = Panel("S275")
ghpython_script_5 = GhPythonScript(matName=panel_4, E="210000", G="80760", rho="75", fy="35")  # -> out, nDMaterial
# ---------- ghpython_script_5: Python ----------
"""Generate a n-Dimensional Elastic Isotropic Material
    Inputs:
        matName: Name of the material.
        E: Young's Modulus [MPa].
        G: Tangential Modulus [MPa].
        v: Poisson ratio.
        rho: specific weight [kN/m3].
        fy: Yield stress value of the material [MPa]
    Output:
       nDMaterial: Material element.
       """


import Grasshopper as gh

def ElasticMaterial(matName, E, G, v, rho, fy):

    E = E * 1000                               # Input value in N/mm2 ---> Output kN/m2
    if v == None:
    	G = G * 1000                           # Input value in N/mm2 ---> Output kN/m2
    	v = (E / (2 * G)) - 1
    else:
    	G = E / (2 * (1 + v))

    rho = rho                                  # Force Density
    fy = fy                                    # Input value in N/mm2
    materialDimension = "nDMaterial"
    materialType = "ElasticIsotropic"
    matName = matName + "_" + materialDimension + "_" + materialType

    return [[matName, E, G, v, rho, fy, materialType]]

checkData = True

if matName is None:
    checkData = False
    msg = "input 'matName' failed to collect data"
    ghenv.Component.AddRuntimeMessage(gh.Kernel.GH_RuntimeMessageLevel.Warning, msg)

if E is None:
    checkData = False
    msg = "input 'E' failed to collect data"
    ghenv.Component.AddRuntimeMessage(gh.Kernel.GH_RuntimeMessageLevel.Warning, msg)


if G is None and v is None:
    checkData = False
    msg = "input 'G' or 'v' failed to collect data"
    ghenv.Component.AddRuntimeMessage(gh.Kernel.GH_RuntimeMessageLevel.Warning, msg)


if rho is None:
    checkData = False
    msg = "input 'rho' failed to collect data"
    ghenv.Component.AddRuntimeMessage(gh.Kernel.GH_RuntimeMessageLevel.Warning, msg)


if checkData != False:
    nDMaterial = ElasticMaterial(matName, E, G, v, rho, fy)
# ---------- end ghpython_script_5 ----------

# ----
# Linear Load
value_list = ValueList({"LocalAxis": 0, "GlobalAxis": 1}, selected="GlobalAxis")
vector_4 = Vector(vector_2)
curve = Curve(data_14)
ghpython_script_6 = GhPythonScript(Force=vector_4, Element=curve, Orientation=value_list)  # -> out, flatten(beamUniformLoad); inputs Force: Vector3d, Element: Curve, Orientation: Int32
# ---------- ghpython_script_6: Python ----------
"""Generate a uniform Distributed Load
    Inputs:
        Force: Straight line representing the structural element.
        Element: Cross section of the element.
        Orientation:  0: Local axis.  1: Global axis. Default is Global axis.
    Output:
       beamUniformLoad: Load element.
       """


import Rhino.Geometry as rg
import ghpythonlib.components as ghcomp
import Grasshopper as gh


def uniformLoad(Force = rg.Vector3d(0,0,0), Element = None, Orientation = 0):

    if Orientation == 0:        # Values on local Axis
        localForce = Force      # Input value in kN ---> Output kN 
    else:
        midPoint = Element.PointAtNormalizedLength(0.5)
        midParameter = Element.ClosestPoint(midPoint, 0.01)[1]
        perpFrame = Element.PerpendicularFrameAt(midParameter)[1]
        xForm = rg.Transform.ChangeBasis(rg.Plane.WorldXY, perpFrame )
        localForce = Force
        localForce.Transform(xForm)

    elementLoad = Element
    loadType = 'beamUniform'

    return [[elementLoad, localForce,  "leaveEmpty", loadType, perpFrame]]


checkData = True

if Force is None:
    checkData = False
    msg = "input 'Force' failed to collect data"
    ghenv.Component.AddRuntimeMessage(gh.Kernel.GH_RuntimeMessageLevel.Warning, msg)

if Element is None:
    checkData = False
    msg = "input 'Element' failed to collect data"
    ghenv.Component.AddRuntimeMessage(gh.Kernel.GH_RuntimeMessageLevel.Warning, msg)


if checkData != False:
    beamUniformLoad = uniformLoad(Force, Element, Orientation)
# ---------- end ghpython_script_6 ----------

# ----
# Linear Load
value_list_2 = ValueList({"LocalAxis": 0, "GlobalAxis": 1}, selected="GlobalAxis")
curve_2 = Curve(data_15)
vector_5 = Vector(vector_3)
ghpython_script_7 = GhPythonScript(Force=vector_5, Element=curve_2, Orientation=value_list_2)  # -> out, flatten(beamUniformLoad); inputs Force: Vector3d, Element: Curve, Orientation: Int32; same code as ghpython_script_6

# ----
# Point Load
file_path_2 = FilePath("C:\GitHub\Alpaca4d\PythonScript\Pre-Processing\Load\PointLoad.py")
read_file_2 = ReadFile(File=file_path_2, PerLineParse=False)
vector_6 = Vector(expr("x*0", Vector(2.518385542, -6.656153768, 0)))
vector_7 = Vector(vector)
point_2 = Point(pointload)
ghpython_script_8 = GhPythonScript(Force=vector_7, Moment=vector_6, Pos=point_2)  # -> out, flatten(LoadWrapper); inputs Force: Vector3d, Moment: Vector3d, Pos: Point3d
# ---------- ghpython_script_8: Python ----------
"""Generate a point load.
    Inputs:
        Force: Input force vector [kN].
        Moment: Input moment vector [kN].
        Pos: Point to apply the loads.
    Output:
       LoadWrapper: Load element.
       """

import Rhino.Geometry as rg
import Grasshopper as gh

def pointLoad(Force, Moment, Pos):

    Pos = Pos
    Force = rg.Vector3d(0,0,0) if Force is None else Force                   # Input value in kN ---> Output kN
    Moment = rg.Vector3d(0,0,0) if Moment is None else Moment                 # Input value in kNm ---> Output kNm
    loadType = "pointLoad"

    return [[Pos, Force, Moment, loadType]]

checkData = True

if Pos is None:
    checkData = False
    msg = "input 'Pos' failed to collect data"
    ghenv.Component.AddRuntimeMessage(gh.Kernel.GH_RuntimeMessageLevel.Warning, msg)


if checkData != False:
    LoadWrapper = pointLoad(Force, Moment, Pos)
# ---------- end ghpython_script_8 ----------

file_path_3 = FilePath("C:\GitHub\Alpaca4d\PythonScript\Pre-Processing\Load\BeamLoad.py")

# ----
# MassLoad
point_3 = Point(data_16)
number = Number(mass)
ghpython_script_9 = GhPythonScript(NodalMass=number, Pos=point_3)  # -> out, flatten(Mass); inputs Pos: Point3d
# ---------- ghpython_script_9: Python ----------
"""Add a concentrated Mass to a node.
    Inputs:
        NodalMass: Mass at point [kg].
        Pos: Point to apply the nodal Mass.
    Output:
       Mass: Mass element.
       """


import Rhino.Geometry as rg
import Grasshopper as gh


def MassLoad(Pos, NodalMass):

    NodalMass = rg.Point3d(NodalMass, NodalMass, NodalMass)
    return [[Pos, NodalMass]]

checkData = True

if Pos is None:
    checkData = False
    msg = "input 'Pos' failed to collect data"
    ghenv.Component.AddRuntimeMessage(gh.Kernel.GH_RuntimeMessageLevel.Warning, msg)

if NodalMass is None:
    checkData = False
    msg = "input 'NodalMass' failed to collect data"
    ghenv.Component.AddRuntimeMessage(gh.Kernel.GH_RuntimeMessageLevel.Warning, msg)

if checkData != False:
	Mass = MassLoad(Pos, NodalMass)
# ---------- end ghpython_script_9 ----------

read_file_3 = ReadFile(File=file_path_3, PerLineParse=False)

# ----
# doubleT CrossSection
file_path_4 = FilePath("C:\GitHub\Alpaca4d\PythonScript\Pre-Processing\Section\doubleTCrossSection.py")
read_file_4 = ReadFile(File=file_path_4, PerLineParse=False)
ghpython_script_10 = GhPythonScript(
    Code=read_file_4,
    SectionName="TT",
    Bsup="300",
    Binf="600",
    H="500",
    Tsup="100",
    Tinf="100",
    Tw="100",
    UniaxialMaterial=ghpython_script.uniaxialMaterial)  # -> Out, CrossSection

# ----
# Circular CrossSection
panel_5 = Panel("400")
ghpython_script_11 = GhPythonScript(sectionName="CHS", diameter=panel_5, thickness="40", uniaxialMaterial=ghpython_script.uniaxialMaterial)  # -> out, CrossSection
# ---------- ghpython_script_11: Python ----------
"""Generate a circular cross section
    Inputs:
        sectionName: Name of the section.
        diameter: Diameter of cross section [mm].
        thickness: Wall thickness [mm].
        uniaxialMaterial: Material element.
    Output:
       CrossSection: CrossSection element.
       """


import math
import Grasshopper as gh

def CircleCrossSection(sectionName, diameter, thickness, uniaxialMaterial):
    sectionName = sectionName
    shape = "circular"
    diameter = diameter / 1000 			# Input value in mm ---> Output m
    thickness = thickness / 1000        # Input value in mm ---> Output m
    if thickness == 0 or thickness == diameter / 2:
        Area = math.pow(diameter,2)/4  * math.pi
        Ay = Area * 0.9
        Az = Area * 0.9
        Iyy = math.pow(diameter,4)/64 * math.pi
        Izz = Iyy
        J = pow(diameter,4)/32 * math.pi
    elif thickness < diameter/2 and thickness >= 0:
        Area = (math.pow(diameter,2)-math.pow((diameter-2*thickness),2))/4 * math.pi
        Ay = Area * 0.9
        Az = Area * 0.9
        Iyy = (math.pow(diameter,4)-math.pow((diameter-2*thickness),4))/64 * math.pi
        Izz = Iyy
        J = (math.pow(diameter,4)-math.pow((diameter-2*thickness),4))/32 * math.pi
    else:
        msg = "Incorrect values. Thickness has to be greater than D/2 and greater than 0"
        ghenv.Component.AddRuntimeMessage(gh.Kernel.GH_RuntimeMessageLevel.Error, msg)

    material = uniaxialMaterial

    return [[ Area, Ay, Az, Iyy, Izz, J, material, [shape, diameter, thickness], sectionName ]]


checkData = True

if sectionName is None:
    checkData = False
    msg = "input 'sectionName' failed to collect data"
    ghenv.Component.AddRuntimeMessage(gh.Kernel.GH_RuntimeMessageLevel.Warning, msg)

if diameter is None:
    checkData = False
    msg = "input 'diameter' failed to collect data"
    ghenv.Component.AddRuntimeMessage(gh.Kernel.GH_RuntimeMessageLevel.Warning, msg)

if thickness is None:
    checkData = False
    msg = "input 'thickness' failed to collect data"
    ghenv.Component.AddRuntimeMessage(gh.Kernel.GH_RuntimeMessageLevel.Warning, msg)

if uniaxialMaterial is None:
    checkData = False
    msg = "input 'uniaxialMaterial' failed to collect data"
    ghenv.Component.AddRuntimeMessage(gh.Kernel.GH_RuntimeMessageLevel.Warning, msg)


if checkData != False:
    CrossSection = CircleCrossSection(sectionName, diameter, thickness, uniaxialMaterial)
# ---------- end ghpython_script_11 ----------

# ----
# Elastic Membrane Plate Section
panel_6 = Panel("concreteSlab")
ghpython_script_12 = GhPythonScript(sectionName=panel_6, thickness="250", nDMaterial=ghpython_script_5.nDMaterial)  # -> out, CrossSection
# ---------- ghpython_script_12: Python ----------
"""Generate a Plate cross section
    Inputs:
        sectionName: Name of the section.
        thickness: Height of the cross section [mm].
        nDMaterial: Material element.
    Output:
       CrossSection: Elastic Plate Section element.
       """

import math
import Grasshopper as gh

def ElasticMembranePlateSection(sectionName, thickness, nDMaterial):
    
    sectionName = sectionName
    thickness = thickness / 1000		# Input value in mm ---> Output m
    material = nDMaterial
    sectionType = "ElasticMembranePlateSection"
    sectionProperties = sectionName + "_" + sectionType
    return [[sectionProperties, thickness, material]]

checkData = True

if sectionName is None:
    checkData = False
    msg = "input 'sectionName' failed to collect data"
    ghenv.Component.AddRuntimeMessage(gh.Kernel.GH_RuntimeMessageLevel.Warning, msg)

if thickness is None:
    checkData = False
    msg = "input 'thickness' failed to collect data"
    ghenv.Component.AddRuntimeMessage(gh.Kernel.GH_RuntimeMessageLevel.Warning, msg)

if nDMaterial is None:
    checkData = False
    msg = "input 'nDMaterial' failed to collect data"
    ghenv.Component.AddRuntimeMessage(gh.Kernel.GH_RuntimeMessageLevel.Warning, msg)

if checkData != False:
    CrossSection = ElasticMembranePlateSection(sectionName, thickness, nDMaterial)
# ---------- end ghpython_script_12 ----------

curve_3 = Curve(truss)

# ----
# meshToShell
mesh = Mesh(shell)
ghpython_script_13 = GhPythonScript(Mesh=mesh, Colour=ColourSwatch(SwatchColor=RGB(242, 19, 19)), CrossSection=ghpython_script_12.CrossSection)  # -> out, flatten(shellWrapper); inputs Mesh: Mesh
# ---------- ghpython_script_13: Python ----------
"""Generate a Shell MITC4 element
    Inputs:
        Mesh: QuadMesh representing the structural element.
        CrossSection: Cross section of the mesh.
        Colour: Colour of the element.
    Output:
       shellWrapper: Shell with properties.
       """


import Rhino.Geometry as rg
import Grasshopper as gh
from System.Drawing import Color 

def MeshToShell(Mesh, Colour, CrossSection):
    
    Mesh.Unweld(0, True)
    elementType = []
    if Mesh.Vertices.Count == 4:
        elementType = "ShellMITC4"
        if Colour is None:
            colour = Color.FromArgb(49, 159, 255)
        else:
            colour = Colour
    else:
        elementType = "shellDKGT"
        if Colour is None:
            colour = Color.FromArgb(49, 159, 255)
        else:
            colour = Colour
    newMesh = Mesh
    
    CrossSection = CrossSection
    return [ newMesh , elementType, CrossSection, colour] 

checkData = True

if Mesh is None:
    checkData = False
    msg = "input 'Mesh' failed to collect data"
    ghenv.Component.AddRuntimeMessage(gh.Kernel.GH_RuntimeMessageLevel.Warning, msg)

if CrossSection is None:
    checkData = False
    msg = "input 'CrossSection' failed to collect data"
    ghenv.Component.AddRuntimeMessage(gh.Kernel.GH_RuntimeMessageLevel.Warning, msg)


if checkData != False:
    Mesh.Unweld(0, True)
    explodedMesh = Mesh.ExplodeAtUnweldedEdges()
    shellWrapper = []
    if explodedMesh.Length > 0:
        for mesh in explodedMesh:
            shellWrapper.append(MeshToShell(mesh, Colour, CrossSection))
    elif explodedMesh.Length == 0:
            shellWrapper.append(MeshToShell(Mesh, Colour, CrossSection))
# ---------- end ghpython_script_13 ----------

# ----
# LineToTruss
value_list_3 = ValueList({"Truss": 0, "Beam": 1}, selected="Truss")
colour_swatch = ColourSwatch(SwatchColor=RGB(255, 200, 0))
ghpython_script_14 = GhPythonScript(Line=curve_3, CrossSection=ghpython_script_11.CrossSection, orientSection="0", beamType=value_list_3)  # -> out, flatten(beamWrapper); inputs Line: Curve
# ---------- ghpython_script_14: Python ----------
"""Generate a Timoshenko Beam element or a Truss element
    Inputs:
        Line: Straight line representing the structural element.
        CrossSection: Cross section of the element.
        Colour: Colour of the element.
        orientSection: Rotation angle in degrees about local X-axis.
        beamType:  0: Truss  1: Beam. Default is Beam.
    Output:
       beamWrapper: Beam with properties.
       """

import Rhino.Geometry as rg
import Rhino.RhinoMath
from System.Drawing import Color
import ghpythonlib.components as ghcomp
import Grasshopper as gh

def LineToBeam(Line, CrossSection, Colour, orientSection, beamType):

    if orientSection is None:
        orientSection = 0

    if beamType is None:
        beamType = 1



    Line = Line
    if beamType == 1 or None:
        elementType = "ElasticTimoshenkoBeam"
        if Colour is None:
            colour = Color.FromArgb(195, 195, 13)
        else:
            colour = Colour
    elif beamType == 0:
        elementType = "Truss"
        if Colour is None:
            colour = Color.FromArgb(179, 62, 143)
        else:
            colour = Colour

    CrossSection = CrossSection
    

    midPoint =  Line.PointAtNormalizedLength(0.5)
    parameter = Line.ClosestPoint(midPoint, 0.01)[1]
    perpFrame = ghcomp.PerpFrame( Line, parameter )
    perpFrame.Rotate(Rhino.RhinoMath.ToRadians(orientSection), perpFrame.ZAxis, perpFrame.Origin)
    vecGeomTransf = [ perpFrame.XAxis, perpFrame.YAxis, perpFrame.ZAxis ]

    Area = float(CrossSection[0])
    rho = float(CrossSection[6][4])
    massDens = Area * rho


    return [[Line, elementType, CrossSection, vecGeomTransf, colour, massDens, perpFrame]]

checkData = True

if Line is None:
    checkData = False
    msg = "input 'Line' failed to collect data"
    ghenv.Component.AddRuntimeMessage(gh.Kernel.GH_RuntimeMessageLevel.Warning, msg)

if CrossSection is None:
    checkData = False
    msg = "input 'CrossSection' failed to collect data"
    ghenv.Component.AddRuntimeMessage(gh.Kernel.GH_RuntimeMessageLevel.Warning, msg)


if checkData != False:
    beamWrapper = LineToBeam(Line, CrossSection, Colour, orientSection, beamType)
# ---------- end ghpython_script_14 ----------

data_17 = Data([ghpython_script_6.beamUniformLoad, ghpython_script_7.beamUniformLoad, ghpython_script_8.LoadWrapper])

# ----
# LineToBeam
curve_4 = Curve(beam)
ghpython_script_15 = GhPythonScript(Line=curve_4, CrossSection=ghpython_script_10.CrossSection)  # -> out, flatten(beamWrapper); inputs Line: Curve; same code as ghpython_script_14

merge = Merge(Data1=ghpython_script_13.shellWrapper, Data2=ghpython_script_15.beamWrapper, Data3=ghpython_script_14.beamWrapper)
clean_tree = CleanTree(RemoveNulls=True, RemoveInvalid=True, RemoveEmpty=False, Tree=merge)
clean_tree_2 = CleanTree(RemoveNulls=True, RemoveInvalid=True, RemoveEmpty=False, Tree=ghpython_script_3.supportWrapper)
clean_tree_3 = CleanTree(RemoveNulls=True, RemoveInvalid=True, RemoveEmpty=False, Tree=data_17)
clean_tree_4 = CleanTree(RemoveNulls=True, RemoveInvalid=True, RemoveEmpty=False, Tree=ghpython_script_9.Mass)

# ----
# Assemble
ghpython_script_16 = GhPythonScript(Element=flatten(clean_tree), Support=flatten(clean_tree_2), Load=flatten(clean_tree_3), Mass=flatten(clean_tree_4))  # -> out, AlpacaModel, MassOfStructure; inputs Element: list, Support: list, Load: list, Mass: list
# ---------- ghpython_script_16: Python ----------
"""Generate a text file model to be sent to OpenSees
    Inputs:
        Element: Structural element.
        Support: Support element.
        Load: Load element.
        Mass: Mass point.
    Output:
       AlpacaModel: Assembled Alpaca model.
       MassOfStructure: Total mass of the structure [kg].
       """

import sys
import clr
import os

import Rhino.Geometry as rg
import Grasshopper as gh

def Assemble(Element, Support, Load, Mass):
    points = []
    startPointList = []
    endPointList = []
    geomTransf = []
    matWrapper = []
    secTagWrapper = []
    
    for element in Element:
        print(element[0])
        if (element[1] == "ElasticTimoshenkoBeam") or (element[1] == "Truss"): # element[1] retrieve the type of the beam
            
            startPoint = element[0].PointAt(element[0].Domain[0])
            endPoint = element[0].PointAt(element[0].Domain[1])
            points.append(startPoint)
            points.append(endPoint)
            geomTransf.append(element[3])
            matWrapper.append([element[2][6][0], element[2][6][1:] ]) # to be careful because we are assigning "unixial" inside the solver. We need to find a clever way to assigning outside
        elif (element[1] == "ShellMITC4") or (element[1] == "shellDKGT"):
            mesh = element[0]
            vertices = mesh.Vertices
            for i in range(vertices.Count):
                points.append( rg.Point3d.FromPoint3f(vertices[i]) )
            matWrapper.append([element[2][2][0], element[2][2][1:] ])
            secTagWrapper.append([element[2][0], element[2][1:] ])
        elif (element[1] == "bbarBrick") or (element[1] == "FourNodeTetrahedron"):
            mesh = element[0]
            vertices = mesh.Vertices
            for i in range(vertices.Count):
                #points.append( rg.Point3d.FromPoint3f(vertices[i]) )
                points.append( rg.Point3d( vertices[i]) )
            matWrapper.append([element[2][0], element[2][1:]])
    
    # create MatTag
    # use dictionary to delete duplicate
    matNameDict = dict(matWrapper)
    
    matNameList = []
    i = 1
    
    for key, value in matNameDict.iteritems():
        temp = [key,i,value]
        matNameList.append(temp)
        i += 1
    
    openSeesMatTag = []
    for item in matNameList:
        openSeesMatTag.append([ item[0], item[1:] ] )
    
    openSeesMatTag = openSeesMatTag
    matNameDict = dict(openSeesMatTag)
    
    
    # create SecTag
    # use dictionary to delete duplicate
    secTagDict = dict(secTagWrapper)
    secTagList = []
    i = 1
    
    for key, value in secTagDict.iteritems():
        temp = [key,i,value]
        secTagList.append(temp)
        i += 1
    
    openSeesSecTag = []
    for item in secTagList:
        openSeesSecTag.append([ item[0], item[1:] ] )
    
    
    openSeesSecTag = openSeesSecTag
    secTagDict = dict(openSeesSecTag)
    
    #print(secTagDict)
    
    # create GeomTransf
    geomTransf = [row[0] for row in geomTransf ]
    geomTransfList = list(dict.fromkeys(geomTransf))
    geomTransfDict = { geomTransfList[i] : i+1 for i in range(len(geomTransfList) ) }
    
    geomTag = geomTransfDict.values() # elemento a dx (tag)
    geomVec = geomTransfDict.keys() # elemento a sx (vettore)
    
    GeomTransf = []
    for i in range(0, len(geomTag) ) :
        GeomTransf.append( [ geomTag[i], list(rg.Vector3d(geomVec[i])) ] )
    
    GeomTransf = GeomTransf
    
    
    
    oPoints = rg.Point3d.CullDuplicates(points, 0.01)       # Collection of all the points of our geometry
    cloudPoints = rg.PointCloud(oPoints)        # Convert to PointCloud to use ClosestPoint Method
    
    
    ## FOR NODE ##
    openSeesNode = []
    
    for nodeTag, node in enumerate(oPoints):
        openSeesNode.append( [nodeTag, node.X, node.Y, node.Z] )
    
    openSeesNode = openSeesNode
    
    
    ## FOR ELEMENT ##
    
    openSeesBeam = []
    openSeesShell = []
    openSeesSolid = []
    MassOfStructure = 0
    
    for eleTag, element in enumerate(Element):
        if (element[1] == "ElasticTimoshenkoBeam") or (element[1] == "Truss"): # element[1] retrieve the type of the beam
            
            start = element[0].PointAt(element[0].Domain[0])
            end = element[0].PointAt(element[0].Domain[1])
            indexStart = cloudPoints.ClosestPoint(start)
            indexEnd = cloudPoints.ClosestPoint(end)
            
            typeElement = element[1]
            eleTag = eleTag
            eleNodes = [indexStart, indexEnd]
            Area = element[2][0]
            Avy = element[2][1]
            Avz = element[2][2]
            E_mod = element[2][6][1]
            G_mod = element[2][6][2]
            Jxx = element[2][5]
            Iy = element[2][3]
            Iz = element[2][4]
            transfTag = geomTransfDict.setdefault(element[3][0])
            axis1 = [ element[3][0].X, element[3][0].Y, element[3][0].Z ]
            axis2 = [ element[3][1].X, element[3][1].Y, element[3][1].Z ]
            axis3 = [ element[3][2].X, element[3][2].Y, element[3][2].Z ]
            orientVector = [ axis1, axis2, axis3 ]
    
            massDens = element[5]
            #print(massDens)
            sectionGeomProperties = element[2][7]
            color = [element[4][0], element[4][1], element[4][2], element[4][3] ]
            matTag = matNameDict.setdefault(element[2][6][0])[0]
            openSeesBeam.append( [typeElement, eleTag, eleNodes, Area, E_mod, G_mod, Jxx, Iy, Iz, transfTag, massDens, Avy, Avz, orientVector, sectionGeomProperties, matTag, color] )
            
            MassOfStructure += element[0].GetLength() * massDens * 100    # kN to kg
            
        elif (element[1] == "ShellMITC4") or (element[1] == "shellDKGT"):
            typeElement = element[1]
            eleTag = eleTag
            shellNodesRhino = element[0].Vertices
            color = [element[3][0],element[3][1],element[3][2],element[3][3]] 
            indexNode = []
            for node in shellNodesRhino:
                indexNode.append(cloudPoints.ClosestPoint(node) + 1)
            shellNodes = indexNode
            thick = element[2][1]
            secTag = secTagDict.setdefault(element[2][0])[0]
            # sectionProperties = we need to bring some information later probably 
            openSeesShell.append( [ typeElement, eleTag, shellNodes, secTag, thick, color] )
            
            areaMesh = rg.AreaMassProperties.Compute(element[0]).Area
            
            density = element[2][2][4]
            MassOfStructure +=  (areaMesh * thick * density) * 100         # kN to kg
            
            
        elif (element[1] == 'bbarBrick') or (element[1] == "FourNodeTetrahedron"):
            typeElement = element[1]
            eleTag = eleTag
            shellNodesRhino = element[0].Vertices
            indexNode = []
            for node in shellNodesRhino:
                indexNode.append(cloudPoints.ClosestPoint(node) + 1)
            SolidNodes = indexNode
            matTag = matNameDict.setdefault(element[2][0])[0]
            color = [ element[3][0], element[3][1], element[3][2] ]
            # sectionProperties = we need to bring some information later probably 
            openSeesSolid.append( [ typeElement, eleTag, SolidNodes, matTag, [0,0,0], color] )
    
    
    openSeesShell = openSeesShell
    openSeesBeam = openSeesBeam
    openSeesSolid = openSeesSolid
    ## SUPPORT ## 
    
    openSeesSupport = []
    
    for support in Support:
        supportNodeTag = cloudPoints.ClosestPoint(support[0])
        dof_1 = support[1]
        dof_2 = support[2]
        dof_3 = support[3]
        dof_4 = support[4]
        dof_5 = support[5]
        dof_6 = support[6]
        openSeesSupport.append( [supportNodeTag, dof_1, dof_2, dof_3, dof_4, dof_5, dof_6 ] )
    
    openSeesSupport = openSeesSupport
    
    ## FORCE ##
    
    openSeesNodeLoad = []
    openSeesBeamLoad = []
    
    
    for loadWrapper in Load:
        if loadWrapper[3] == "pointLoad":
            nodeTag = cloudPoints.ClosestPoint(loadWrapper[0])
            loadValues = [ loadWrapper[1].X, loadWrapper[1].Y, loadWrapper[1].Z, loadWrapper[2].X, loadWrapper[2].Y, loadWrapper[2].Z ]
            loadType = loadWrapper[3]
            openSeesNodeLoad.append( [nodeTag, loadValues, loadType] )
        elif loadWrapper[3] == "beamUniform":
            for eleTag, element in enumerate(Element):
                equality = rg.GeometryBase.GeometryEquals(loadWrapper[0],element[0])
                if equality:
                    loadValues = [ loadWrapper[1].X, loadWrapper[1].Y, loadWrapper[1].Z ]
                    loadType = loadWrapper[3]
                    openSeesBeamLoad.append( [eleTag, loadValues, loadType] )
                    break
    
    
    openSeesNodeLoad = openSeesNodeLoad
    openSeesBeamLoad = openSeesBeamLoad
    
    
    ## MASS ##
    # find Total mass convering in each node
    
    openSeesNodalMass = []
    
    for item in Mass:
        massNodeTag = cloudPoints.ClosestPoint(item[0])
        massValues = [item[1].X, item[1].Y, item[1].Z]
        openSeesNodalMass.append([ massNodeTag, massValues ])
    
    openSeesNodalMass = openSeesNodalMass
    
    ## ASSEMBLE ##
    
    
    openSeesModel = ([ openSeesNode,
                       GeomTransf,
                       openSeesBeam,
                       openSeesSupport,
                       openSeesNodeLoad,
                       openSeesNodalMass,
                       openSeesBeamLoad,
                       openSeesMatTag,
                       openSeesShell,
                       openSeesSecTag,
                       openSeesSolid])
                       
                       
    ghFilePath = ghenv.Component.Attributes.Owner.OnPingDocument().FilePath
    ghFolderPath = os.path.dirname(ghFilePath)
    
    
    outputPath = os.path.join(ghFolderPath,'assembleData')
    if not os.path.exists(outputPath):
       os.makedirs(outputPath)
       
       
    wrapperFile = os.path.join(outputPath,'openSeesModel.txt')
    with open(wrapperFile, 'w') as f:
     for item in openSeesModel:
            f.write("%s\n" % item)
    
    
    return [openSeesModel, MassOfStructure]


checkData = True

if not Element:
    checkData = False
    msg = "input 'Element' failed to collect data"
    ghenv.Component.AddRuntimeMessage(gh.Kernel.GH_RuntimeMessageLevel.Warning, msg)

if not Support:
    checkData = False
    msg = "input 'Support' failed to collect data"
    ghenv.Component.AddRuntimeMessage(gh.Kernel.GH_RuntimeMessageLevel.Warning, msg)

if not Load:
    msg = "input 'Load' failed to collect data"
    ghenv.Component.AddRuntimeMessage(gh.Kernel.GH_RuntimeMessageLevel.Warning, msg)


if checkData != False:
    AlpacaModel, MassOfStructure = Assemble(Element, Support, Load, Mass)
# ---------- end ghpython_script_16 ----------

data_18 = Data(ghpython_script_16.AlpacaModel)

# ----
# Modal Analyses
panel_7 = Panel("3")
analyze = GhPythonScript(AlpacaModel=data_18, numVibrationModes=panel_7)  # -> out, AlpacaModalOutput, frequency, period; inputs AlpacaModel: list, numVibrationModes: Int32
# ---------- analyze: Python ----------
"""Calculate the Natural Vibration of the structure
    Inputs:
        AlpacaModel: Assemble model to perform Modal Analyses.
        numEigenvalues: Number of modes to be calculated.
    Output:
       AlpacaModalOutput: Analysed Alpaca model.
       frequency: Frequencies of the corrisponding modes [Hz].
       period: Periods of the corrisponding modes [s].
       """


import System
import os
import Grasshopper as gh
import ghpythonlib.treehelpers as th # per data tree

def InitializeModalAnalysis(AlpacaModel, numEigenvalues):
    ghFilePath = ghenv.Component.Attributes.Owner.OnPingDocument().FilePath

    # delete file if already there
    workingDirectory = os.path.dirname(ghFilePath) 
    outputFileName = 'openSeesModalOutputWrapper.txt'

    for dirpath, dirnames, filenames in os.walk(workingDirectory):
        for filename in filenames:
            print(filename)
            if filename == outputFileName:
                file = os.path.join(dirpath,outputFileName)
                os.remove(file)


    ghFolderPath = os.path.dirname(ghFilePath)
    outputFolder = os.path.join(ghFolderPath,'assembleData')
    wrapperFile = os.path.join( outputFolder,'openSeesModel.txt' )



    #userObjectFolder = gh.Folders.DefaultUserObjectFolder
    userObjectFolder = gh.Folders.DefaultAssemblyFolder
    pythonInterpreter = os.path.join(userObjectFolder, r'Alpaca4d\Analyses\WPy64\scripts\winpython.bat')
    fileName = os.path.join(userObjectFolder, r'Alpaca4d\Analyses\DynamicAnalysis\openSees_ModalSolver.py')
    
    wrapperFile = '"' + wrapperFile + '"'
    fileName = '"' + fileName + '"'
    
    p = System.Diagnostics.Process()
    p.StartInfo.RedirectStandardOutput = True
    p.StartInfo.RedirectStandardError = True

    p.StartInfo.UseShellExecute = False
    p.StartInfo.CreateNoWindow = True
    
    p.StartInfo.FileName = pythonInterpreter
    p.StartInfo.Arguments = fileName + " " + wrapperFile + " " + str(numVibrationModes)
    p.Start()
    p.WaitForExit()
    
    
    msg = p.StandardError.ReadToEnd()
    ghenv.Component.AddRuntimeMessage(gh.Kernel.GH_RuntimeMessageLevel.Error, msg)

    ## READ THE OUTPUT FROM THE OPEENSEES_SOLVER
    ## THE ORDER MUST BE THE SAME OF THE OUTPUT LIST IN OpenSeesStaticSolver.py

    outputFile = os.path.join(outputFolder, outputFileName)

    with open(outputFile, 'r') as f:
        lines = f.readlines()
        nodeModalDispWrapper = eval( lines[0].strip() )
        elementModalWrapper = eval( lines[1].strip() )
        period = eval( lines[2].strip() )
        frequency = eval( lines[3].strip() )


    AlpacaModalOutputWrapper = ([nodeModalDispWrapper,
                            elementModalWrapper,
                            period,
                            frequency])

    return [AlpacaModalOutputWrapper, period, frequency]

checkData = True

if not AlpacaModel:
    checkData = False
    msg = "input 'AlpacaModel' failed to collect data"
    ghenv.Component.AddRuntimeMessage(gh.Kernel.GH_RuntimeMessageLevel.Warning, msg)

if numVibrationModes is None:
    checkData = False
    msg = "input 'numEigenvalues' failed to collect data"
    ghenv.Component.AddRuntimeMessage(gh.Kernel.GH_RuntimeMessageLevel.Warning, msg)


if checkData != False:
    AlpacaModalOutput, period, frequency = InitializeModalAnalysis(AlpacaModel, numVibrationModes)
# ---------- end analyze ----------

# ----
# Modal Animate
number_slider = Slider(1, range=0..10)

value_list_4 = ValueList({"tx": 0, "ty": 1, "tz": 2, "txyz": 3}, selected="txyz")

# ---- group: MODAL ANALYSIS
ghpython_script_17 = GhPythonScript(
    AlpacaModalOutput=analyze.AlpacaModalOutput,
    numberMode=number_slider,
    speed=Slider(1, range=1..50),
    Animate=Toggle(False),
    Reset=Button(),
    modelExtrude=Toggle(False))  # -> modelDisp; inputs AlpacaModalOutput: list, numberMode: Int32, speed: Int32, Animate: Boolean, Reset: Boolean, direction: Int32, modelExtrude: Boolean, colorList: list of Color
# ---------- ghpython_script_17: Python ----------
"""Visualize the Modal Shapes
    Inputs:
        AlpacaModalOutput: Analysed Alpaca Model.
        numberMode: number of mode to visualize.
        speed: 
        Animate: True - Animate the model.
        Reset:
        scale: Factor to multiply the modal shapes.
        direction : view relative color of the traslation:
            '0' view traslation X.
            '1' view traslation Y.
            '2' view traslation Z.
            '3' view resulting displacement.
        modelExtrude: True - view extruded model.
        colorList: optional color list to remap number to colors.
    Output:
        ModelDisp: Deformed model for the selected modal shape.
"""

from ghpythonlib.componentbase import executingcomponent as component
import Grasshopper, GhPython
import System
import Rhino
import rhinoscriptsyntax as rs

class MyComponent(component):
    
    def RunScript(self, AlpacaModalOutput, numberMode, speed, Animate, Reset, scale, direction, modelExtrude, colorList):
        import Rhino as rc
        import Rhino.Geometry as rg
        import math as mt
        import ghpythonlib.treehelpers as th # per data tree
        import Grasshopper as gh
        import sys
        import rhinoscriptsyntax as rs
        import Rhino.Display as rd
        from scriptcontext import sticky as st
        import System.Drawing.Color
        import scriptcontext as sc
        #----------------------------------------------------------------------#
                
        def alphat( E, G, I, At ):
            return (E*I)/(G*At)
    
        ## Spostamenti e rotazioni ##
        def spostu( x, L, uI, uJ ):
            return -(-L*uI + uI*x - uJ*x)/L
            
        def spostv( x, L, vI, vJ, thetaI, thetaJ, alphay ):
            return (L**3*thetaI*x + L**3*vI - 2*L**2*thetaI*x**2 - L**2*thetaJ*x**2 + 6*L*alphay*thetaI*x - 6*L*alphay*thetaJ*x + 12*L*alphay*vI + L*thetaI*x**3 + L*thetaJ*x**3 - 3*L*vI*x**2 + 3*L*vJ*x**2 - 6*alphay*thetaI*x**2 + 6*alphay*thetaJ*x**2 - 12*alphay*vI*x + 12*alphay*vJ*x + 2*vI*x**3 - 2*vJ*x**3)/(L*(L**2 + 12*alphay))
            
        def spostw( x, L, wI, wJ, psiI, psiJ, alphaz ):
            return -(L**3*psiI*x - L**3*wI - 2*L**2*psiI*x**2 - L**2*psiJ*x**2 - 6*L*alphaz*psiI*x + 6*L*alphaz*psiJ*x + 12*L*alphaz*wI + L*psiI*x**3 + L*psiJ*x**3 + 3*L*wI*x**2 - 3*L*wJ*x**2 + 6*alphaz*psiI*x**2 - 6*alphaz*psiJ*x**2 - 12*alphaz*wI*x + 12*alphaz*wJ*x - 2*wI*x**3 + 2*wJ*x**3)/(L*(L**2 - 12*alphaz))
            
        def thetaz(x, L, vI, vJ, thetaI, thetaJ, alphay): 
            return (L**3*thetaI - 4*L**2*thetaI*x - 2*L**2*thetaJ*x + 12*L*alphay*thetaI + 3*L*thetaI*x**2 + 3*L*thetaJ*x**2 - 6*L*vI*x + 6*L*vJ*x - 12*alphay*thetaI*x + 12*alphay*thetaJ*x + 6*vI*x**2 - 6*vJ*x**2)/(L*(L**2 + 12*alphay))
            
        def phix(x, L, phiI, phiJ):
            return -(-L*phiI + phiI*x - phiJ*x)/L
    
        def psiy(x, L, wI, wJ, psiI, psiJ, alphaz): 
            return (L**3*psiI - 4*L**2*psiI*x - 2*L**2*psiJ*x - 12*L*alphaz*psiI + 3*L*psiI*x**2 + 3*L*psiJ*x**2 + 6*L*wI*x - 6*L*wJ*x + 12*alphaz*psiI*x - 12*alphaz*psiJ*x - 6*wI*x**2 + 6*wJ*x**2)/(L*(L**2 - 12*alphaz))
            
        def gammay( L, vI, vJ, thetaI, thetaJ, alphay): 
    
            return (L*thetaI + L*thetaJ + 2*vI - 2*vJ)/(L*(L**2 + 12*alphay))
            
        def gammaz( L, wI, wJ, psiI, psiJ, alphaz):
    
            return -(L*psiI + L*psiJ - 2*wI + 2*wJ)/(L*(L**2 - 12*alphaz))
    
        ##------------------------------------------------------------------------- --##
    
        def scaleAutomatic( Num , Den ):
            if Den < 0.1 :
                return Num
            else :
                return Num*1/Den
    
        def linspace(a, b, n=100):
            if n < 2:
                return b
            diff = (float(b) - a)/(n - 1)
            return [diff * i + a  for i in range(n)]
    
        ## Funzione rettangolo ##
        def AddRectangleFromCenter(plane, width, height):
            a = plane.PointAt(-width * 0.5, -height * 0.5 )
            b = plane.PointAt(-width * 0.5,  height * 0.5 )
            c = plane.PointAt( width * 0.5,  height * 0.5 )
            d = plane.PointAt( width * 0.5,  -height * 0.5 )
            #rectangle = rg.PolylineCurve( [a, b, c, d, a] )
            rectangle  = [a, b, c, d] 
            return rectangle
            
        ## Funzione cerchio ##
        def AddCircleFromCenter( plane, radius):
            t = linspace( 0 , 1.80*mt.pi, 15 )
            a = []
            for ti in t:
                x = radius*mt.cos(ti)
                y = radius*mt.sin(ti)
                a.append( plane.PointAt( x, y ) )
            #circle = rg.PolylineCurve( a )
            circle  = a 
            return circle
    
        def AddIFromCenter(plane, Bsup, tsup, Binf, tinf, H, ta, yg):
    
            p1 = plane.PointAt( -(yg - tinf), ta/2 )
            p2 = plane.PointAt( -(yg - tinf), Binf/2 )
            p3 = plane.PointAt( -yg, Binf/2 )
            p4 = plane.PointAt( -yg, -Binf/2 )
            p5 = plane.PointAt( -(yg - tinf), -Binf/2 ) 
            p6 = plane.PointAt( -(yg - tinf), -ta/2 )
            p7 = plane.PointAt( (H - yg - tsup), -ta/2)
            p8 = plane.PointAt( (H - yg - tsup), -Bsup/2 )
            p9 = plane.PointAt( (H - yg ), -Bsup/2 )
            p10 = plane.PointAt( (H - yg ), Bsup/2 )
            p11 = plane.PointAt( (H - yg - tsup), Bsup/2 )
            p12 = plane.PointAt( (H - yg - tsup), ta/2 )
    
            wirframe  = [ p1, p2, p3, p4, p5, p6, p7, p8, p9, p10, p11, p12 ] 
            return wirframe
            
        def defShellQuad( ele, node, nodeDisp, scaleDef ):
            
            eleTag = ele[0]
            eleNodeTag = ele[1]
            color = ele[2][2]
            thick = ele[2][1]
            index1 = eleNodeTag[0]
            index2 = eleNodeTag[1]
            index3 = eleNodeTag[2]
            index4 = eleNodeTag[3]
            
            trasl1 = nodeDisp.get( index1 -1 , "never")[0]
            rotate1 = nodeDisp.get( index1 -1 , "never")[1]
            
            trasl2 = nodeDisp.get( index2 -1 , "never")[0]
            rotate2 = nodeDisp.get( index2 -1 , "never")[1]
            
            trasl3 = nodeDisp.get( index3 -1 , "never")[0]
            rotate3 = nodeDisp.get( index3 -1 , "never")[1]
            
            trasl4 = nodeDisp.get( index4 -1 , "never")[0]
            rotate4 = nodeDisp.get( index4 -1 , "never")[1]
            
            ## CREO IL MODELLO DEFORMATO  ##
            
            pointDef1 = rg.Vector3d.Clone( node.get( index1 -1 , "never") )
            pointDef2 = rg.Vector3d.Clone( node.get( index2 -1 , "never") )
            pointDef3 = rg.Vector3d.Clone( node.get( index3 -1 , "never") )
            pointDef4 = rg.Vector3d.Clone( node.get( index4 -1 , "never") )
            vectortrasl1 = rg.Transform.Translation( rg.Vector3d(trasl1.X, trasl1.Y, trasl1.Z)*scaleDef )
            pointDef1.Transform( vectortrasl1 )
            vectortrasl2 = rg.Transform.Translation( rg.Vector3d(trasl2.X, trasl2.Y, trasl2.Z)*scaleDef )
            pointDef2.Transform( vectortrasl2 )
            vectortrasl3 = rg.Transform.Translation( rg.Vector3d(trasl3.X, trasl3.Y, trasl3.Z)*scaleDef )
            pointDef3.Transform( vectortrasl3 )
            vectortrasl4 = rg.Transform.Translation( rg.Vector3d(trasl4.X, trasl4.Y, trasl4.Z)*scaleDef )
            pointDef4.Transform( vectortrasl4 )
            shellDefModel = rg.Mesh()
            shellDefModel.Vertices.Add( pointDef1 ) #0
            shellDefModel.Vertices.Add( pointDef2 ) #1
            shellDefModel.Vertices.Add( pointDef3 ) #2
            shellDefModel.Vertices.Add( pointDef4 ) #3
            
            
            shellDefModel.Faces.AddFace(0, 1, 2, 3)
            colour = rs.CreateColor( color[0], color[1], color[2] )
            shellDefModel.VertexColors.CreateMonotoneMesh( colour )
    
            vt = shellDefModel.Vertices
            shellDefModel.FaceNormals.ComputeFaceNormals()
            fid,MPt = shellDefModel.ClosestPoint(vt[0],0.01)
            normalFace = shellDefModel.FaceNormals[fid]
            vectormoltiplicate = rg.Vector3d.Multiply( -normalFace, thick/2 )
            trasl = rg.Transform.Translation( vectormoltiplicate )
            moveShell = rg.Mesh.DuplicateMesh(shellDefModel)
            moveShell.Transform( trasl )
            extrudeShell = rg.Mesh.Offset( moveShell, thick, True, normalFace)
            return  [shellDefModel,[trasl1, trasl2, trasl3, trasl4], [rotate1, rotate2, rotate3, rotate4], extrudeShell ]
    
        def defShellTriangle( ele, node, nodeDisp, scaleDef ):
            
            eleTag = ele[0]
            eleNodeTag = ele[1]
            color = ele[2][2]
            thick = ele[2][1]
            
            index1 = eleNodeTag[0]
            index2 = eleNodeTag[1]
            index3 = eleNodeTag[2]
            
            trasl1 = nodeDisp.get( index1 -1 , "never")[0]
            rotate1 = nodeDisp.get( index1 -1 , "never")[1]
            
            trasl2 = nodeDisp.get( index2 -1 , "never")[0]
            rotate2 = nodeDisp.get( index2 -1 , "never")[1]
            
            trasl3 = nodeDisp.get( index3 -1 , "never")[0]
            rotate3 = nodeDisp.get( index3 -1 , "never")[1]
            
            ## CREO IL MODELLO DEFORMATO  ##
            pointDef1 = rg.Point3d.Clone( node.get( index1 -1 , "never") )
            pointDef2 = rg.Point3d.Clone( node.get( index2 -1 , "never") )
            pointDef3 = rg.Point3d.Clone( node.get( index3 -1 , "never") )
            vectortrasl1 = rg.Transform.Translation( rg.Vector3d(trasl1.X, trasl1.Y, trasl1.Z)*scaleDef )
            pointDef1.Transform( vectortrasl1 )
            vectortrasl2 = rg.Transform.Translation( rg.Vector3d(trasl2.X, trasl2.Y, trasl2.Z)*scaleDef )
            pointDef2.Transform( vectortrasl2 )
            vectortrasl3 = rg.Transform.Translation( rg.Vector3d(trasl3.X, trasl3.Y, trasl3.Z)*scaleDef )
            pointDef3.Transform( vectortrasl3 )
            shellDefModel = rg.Mesh()
            shellDefModel.Vertices.Add( pointDef1 ) #0
            shellDefModel.Vertices.Add( pointDef2 ) #1
            shellDefModel.Vertices.Add( pointDef3 ) #2
            
            shellDefModel.Faces.AddFace(0, 1, 2)
            colour = rs.CreateColor( color[0], color[1], color[2] )
            vt = shellDefModel.Vertices
            shellDefModel.FaceNormals.ComputeFaceNormals()
            fid,MPt = shellDefModel.ClosestPoint(vt[0],0.01)
            normalFace = shellDefModel.FaceNormals[fid]
            vectormoltiplicate = rg.Vector3d.Multiply( -normalFace, thick/2 )
            trasl = rg.Transform.Translation( vectormoltiplicate )
            moveShell = rg.Mesh.DuplicateMesh(shellDefModel)
            moveShell.Transform( trasl )
            extrudeShell = rg.Mesh.Offset( moveShell, thick, True, normalFace)
            return  [shellDefModel,[trasl1, trasl2, trasl3], [rotate1, rotate2, rotate3], extrudeShell ]
    
        def defSolid( ele, node, nodeDisp, scaleDef ):
            
            eleTag = ele[0]
            eleNodeTag = ele[1]
            color = ele[2][1]
            thick = ele[2][1]
            #print( eleNodeTag )
            index1 = eleNodeTag[0]
            index2 = eleNodeTag[1]
            index3 = eleNodeTag[2]
            index4 = eleNodeTag[3]
            index5 = eleNodeTag[4]
            index6 = eleNodeTag[5]
            index7 = eleNodeTag[6]
            index8 = eleNodeTag[7]
            
            trasl1 = nodeDisp.get( index1 -1 , "never")
            trasl2 = nodeDisp.get( index2 -1 , "never")
            trasl3 = nodeDisp.get( index3 -1 , "never")
            trasl4 = nodeDisp.get( index4 -1 , "never")
            trasl5 = nodeDisp.get( index5 -1 , "never")
            trasl6 = nodeDisp.get( index6 -1 , "never")
            trasl7 = nodeDisp.get( index7 -1 , "never")
            trasl8 = nodeDisp.get( index8 -1 , "never")
            
            ## CREO IL MODELLO DEFORMATO  ##
            pointDef1 = rg.Point3d.Clone( node.get( index1 -1 , "never") )
            pointDef2 = rg.Point3d.Clone( node.get( index2 -1 , "never") )
            pointDef3 = rg.Point3d.Clone( node.get( index3 -1 , "never") )
            pointDef4 = rg.Point3d.Clone( node.get( index4 -1 , "never") )
            pointDef5 = rg.Point3d.Clone( node.get( index5 -1 , "never") )
            pointDef6 = rg.Point3d.Clone( node.get( index6 -1 , "never") )
            pointDef7 = rg.Point3d.Clone( node.get( index7 -1 , "never") )
            pointDef8 = rg.Point3d.Clone( node.get( index8 -1 , "never") )
            vectortrasl1 = rg.Transform.Translation( rg.Vector3d(trasl1.X, trasl1.Y, trasl1.Z)*scaleDef )
            pointDef1.Transform( vectortrasl1 )
            vectortrasl2 = rg.Transform.Translation( rg.Vector3d(trasl2.X, trasl2.Y, trasl2.Z)*scaleDef )
            pointDef2.Transform( vectortrasl2 )
            vectortrasl3 = rg.Transform.Translation( rg.Vector3d(trasl3.X, trasl3.Y, trasl3.Z)*scaleDef )
            pointDef3.Transform( vectortrasl3 )
            vectortrasl4 = rg.Transform.Translation( rg.Vector3d(trasl4.X, trasl4.Y, trasl4.Z)*scaleDef )
            pointDef4.Transform( vectortrasl4 )
            vectortrasl5 = rg.Transform.Translation( rg.Vector3d(trasl5.X, trasl5.Y, trasl5.Z)*scaleDef )
            pointDef5.Transform( vectortrasl1 )
            vectortrasl6 = rg.Transform.Translation( rg.Vector3d(trasl6.X, trasl6.Y, trasl6.Z)*scaleDef )
            pointDef6.Transform( vectortrasl2 )
            vectortrasl7 = rg.Transform.Translation( rg.Vector3d(trasl7.X, trasl7.Y, trasl7.Z)*scaleDef )
            pointDef7.Transform( vectortrasl3 )
            vectortrasl8 = rg.Transform.Translation( rg.Vector3d(trasl8.X, trasl8.Y, trasl8.Z)*scaleDef )
            pointDef8.Transform( vectortrasl4 )
            
            shellDefModel = rg.Mesh()
            shellDefModel.Vertices.Add( pointDef1 ) #0
            shellDefModel.Vertices.Add( pointDef2 ) #1
            shellDefModel.Vertices.Add( pointDef3 ) #2
            shellDefModel.Vertices.Add( pointDef4 ) #3
            shellDefModel.Vertices.Add( pointDef5 ) #4
            shellDefModel.Vertices.Add( pointDef6 ) #5
            shellDefModel.Vertices.Add( pointDef7 ) #6
            shellDefModel.Vertices.Add( pointDef8 ) #7
    
            shellDefModel.Faces.AddFace(0, 1, 2, 3)
            shellDefModel.Faces.AddFace(4, 5, 6, 7)
            shellDefModel.Faces.AddFace(0, 1, 5, 4)
            shellDefModel.Faces.AddFace(1, 2, 6, 5)
            shellDefModel.Faces.AddFace(2, 3, 7, 6)
            shellDefModel.Faces.AddFace(3, 0, 4, 7)
            
            colour = rs.CreateColor( color[0], color[1], color[2] )
            shellDefModel.VertexColors.CreateMonotoneMesh( colour )
            return  [shellDefModel,[trasl1, trasl2, trasl3,trasl4, trasl5, trasl6, trasl7, trasl8 ]]
    
        def defTetraSolid( ele, node, nodeDisp, scaleDef ):
            
            eleTag = ele[0]
            eleNodeTag = ele[1]
            color = ele[2][1]
            #print( eleNodeTag )
            index1 = eleNodeTag[0]
            index2 = eleNodeTag[1]
            index3 = eleNodeTag[2]
            index4 = eleNodeTag[3]
            
            trasl1 = nodeDisp.get( index1 -1 , "never")
            trasl2 = nodeDisp.get( index2 -1 , "never")
            trasl3 = nodeDisp.get( index3 -1 , "never")
            trasl4 = nodeDisp.get( index4 -1 , "never")
            
            ## CREO IL MODELLO DEFORMATO  ##
            pointDef1 = rg.Point3d.Clone( node.get( index1 -1 , "never") )
            pointDef2 = rg.Point3d.Clone( node.get( index2 -1 , "never") )
            pointDef3 = rg.Point3d.Clone( node.get( index3 -1 , "never") )
            pointDef4 = rg.Point3d.Clone( node.get( index4 -1 , "never") )
            
            vectortrasl1 = rg.Transform.Translation( rg.Vector3d(trasl1.X, trasl1.Y, trasl1.Z)*scaleDef )
            pointDef1.Transform( vectortrasl1 )
            vectortrasl2 = rg.Transform.Translation( rg.Vector3d(trasl2.X, trasl2.Y, trasl2.Z)*scaleDef )
            pointDef2.Transform( vectortrasl2 )
            vectortrasl3 = rg.Transform.Translation( rg.Vector3d(trasl3.X, trasl3.Y, trasl3.Z)*scaleDef )
            pointDef3.Transform( vectortrasl3 )
            vectortrasl4 = rg.Transform.Translation( rg.Vector3d(trasl4.X, trasl4.Y, trasl4.Z)*scaleDef )
            pointDef4.Transform( vectortrasl4 )
    
            shellDefModel = rg.Mesh()
            shellDefModel.Vertices.Add( pointDef1 ) #0
            shellDefModel.Vertices.Add( pointDef2 ) #1
            shellDefModel.Vertices.Add( pointDef3 ) #2
            shellDefModel.Vertices.Add( pointDef4 ) #3
            
            
            shellDefModel.Faces.AddFace( 0, 1, 2 )
            shellDefModel.Faces.AddFace( 0, 1, 3 )
            shellDefModel.Faces.AddFace( 1, 2, 3 )
            shellDefModel.Faces.AddFace( 0, 2, 3 )
            colour = rs.CreateColor( color[0], color[1], color[2] )
            shellDefModel.VertexColors.CreateMonotoneMesh( colour )
            
            return  [shellDefModel,[trasl1, trasl2, trasl3, trasl4]]
        ## node e nodeDisp son dictionary ##
        def defValueTimoshenkoBeam( ele, node, nodeDisp, scaleDef ):
            #---------------- WORLD PLANE ----------------------#
            WorldPlane = rg.Plane.WorldXY
            #--------- Propriety TimoshenkoBeam  ----------------#
            TagEle = ele[0]
            propSection = ele[2]
            indexStart = ele[1][0]
            indexEnd = ele[1][1]
            color = propSection[12]
            E = propSection[1]
            G = propSection[2]
            A = propSection[3]
            Avz = propSection[4]
            Avy = propSection[5]
            Jxx = propSection[6]
            Iy = propSection[7]
            Iz = propSection[8]
            #---- traslation and rotation index start & end ------- #
            traslStart = nodeDisp.get( indexStart -1 , "never")[0]
            rotateStart = nodeDisp.get( indexStart -1 , "never")[1]
            traslEnd = nodeDisp.get( indexEnd -1 , "never")[0]
            rotateEnd = nodeDisp.get( indexEnd -1 , "never")[1]
            ##-------------------------------------------- ------------##
            pointStart = node.get( indexStart -1 , "never")
            pointEnd = node.get( indexEnd -1 , "never")
            line = rg.LineCurve( pointStart, pointEnd )
            #-------------------------versor ---------------------------#
            axis1 =  rg.Vector3d( propSection[9][0][0], propSection[9][0][1], propSection[9][0][2]  )
            axis2 =  rg.Vector3d( propSection[9][1][0], propSection[9][1][1], propSection[9][1][2]  )
            axis3 =  rg.Vector3d( propSection[9][2][0], propSection[9][2][1], propSection[9][2][2]  )
            versor = [ axis1, axis2, axis3 ] 
            #---------- WORLD PLANE on point start of line ---------------#
            traslPlane = rg.Transform.Translation( pointStart.X, pointStart.Y, pointStart.Z )
            WorldPlane.Transform( traslPlane )
            #-------------------------------------------------------------#
            planeStart = rg.Plane(pointStart, axis1, axis2 )
            #planeStart = rg.Plane(pointStart, axis3 )
            localPlane = planeStart
            xform = rg.Transform.ChangeBasis( WorldPlane, localPlane )
            localTraslStart = rg.Vector3d( traslStart )
            vectorTrasform = rg.Transform.TransformList( xform, [ traslStart, rotateStart, traslEnd, rotateEnd ] )
            #print( vectorTrasform[0] )
            localTraslStart = vectorTrasform[0]
            uI1 = localTraslStart.X # spostamento in direzione dell'asse rosso 
            uI2 = localTraslStart.Y # spostamento in direzione dell'asse verde
            uI3 = localTraslStart.Z # spostamento linea d'asse
            localRotStart = vectorTrasform[1]
            rI1 = localRotStart.X # 
            rI2 = localRotStart.Y # 
            rI3 = localRotStart.Z # 
            localTraslEnd = vectorTrasform[2]
            uJ1 = localTraslEnd.X # spostamento in direzione dell'asse rosso 
            uJ2 = localTraslEnd.Y # spostamento in direzione dell'asse verde
            uJ3 = localTraslEnd.Z # spostamento linea d'asse
            localRotEnd = vectorTrasform[3]
            rJ1 = localRotEnd[0] #  
            rJ2 = localRotEnd[1]  # 
            rJ3 = localRotEnd[2]  # 
            ##------------------ displacement value -------------------------##
            Length = rg.Curve.GetLength( line )
            segmentCount = Length/0.5
            DivCurve = line.DivideByCount( segmentCount, True )
            if DivCurve == None:
                DivCurve = [ 0, Length]
                
            #s = dg.linspace(0,Length, len(PointsDivLength))
            AlphaY = alphat( E, G, Iy, Avz )
            AlphaZ = alphat( E, G, Iz, Avy )
            
            globalTransVector = []
            globalRotVector = []
            defPoint = []
            defSection = []
            #----------------------- local to global-------------------------#
            xform2 = xform.TryGetInverse()
            #----------------------------------------------------------------#
            for index, x in enumerate(DivCurve):
                beamPoint = line.PointAt(DivCurve[index]) 
                ## SPOSTAMENTO IN DIREZIONE DELL' ASSE 3 ##
                u3 = spostu(x, Length, uI3, uJ3)
                u3Vector = u3*axis3
                ## SPOSTAMENTO IN DIREZIONE DELL' ASSE 1 ##
                v1 =  spostv(x, Length, uI1, uJ1, rI2, rJ2, AlphaY)
                v1Vector = v1*axis1 
                ## SPOSTAMENTO IN DIREZIONE DELL' ASSE 2 ##
                v2 =  spostw(x, Length, uI2, uJ2, rI1, rJ1, AlphaZ)
                v2Vector = v2*axis2 
                
                ## RISULTANTE SPOSTAMENTI ##
                transResult = v1Vector + v2Vector + u3Vector
                
                r2x =  thetaz(x, Length, uI1, uJ1, rI2, rJ2, AlphaY)
                r1x =  psiy(x, Length, uI2, uJ2, rI1, rJ1, AlphaZ)
                r3x = phix(x, Length, rI3, rJ3)
                
                rotResult = r1x*axis1 + r2x*axis2 + r3x*axis3
                
                trasl = rg.Transform.Translation( transResult*scaleDef )
                beamPoint.Transform( trasl )
                defPoint.append( beamPoint )
                
                sectionPlane = rg.Plane( beamPoint, axis1, axis2 )
                sectionPlane.Rotate( scaleDef*r1x, axis1, beamPoint )
                sectionPlane.Rotate( scaleDef*r2x, axis2, beamPoint )
                sectionPlane.Rotate( scaleDef*r3x, axis3, beamPoint )
                if dimSection[0] == 'rectangular' :
                    width, height = dimSection[1], dimSection[2]
                    section = AddRectangleFromCenter( sectionPlane, width, height )
                    defSection.append( section )
                elif dimSection[0] == 'circular' :
                    radius1  = dimSection[1]/2
                    radius2  = dimSection[1]/2 - dimSection[2]
                    section1 = AddCircleFromCenter( sectionPlane, radius1 )
                    if (radius1 - radius2 ) == 0 :
                        defSection.append( section1 )
                    else :
                        section2 = AddCircleFromCenter( sectionPlane, radius2 )
                        defSection.append( [ section1, section2 ] )
                elif dimSection[0] == 'doubleT' :
                    Bsup = dimSection[1]
                    tsup = dimSection[2]
                    Binf = dimSection[3]
                    tinf = dimSection[4]
                    H =  dimSection[5]
                    ta =  dimSection[6]
                    yg =  dimSection[7]
                    section = AddIFromCenter( sectionPlane, Bsup, tsup, Binf, tinf, H, ta, yg )
                    defSection.append( section )
                elif dimSection[0] == 'Generic' :
                    radius  = dimSection[1]
                    section = AddCircleFromCenter( sectionPlane, radius )
                    defSection.append( section )
            
                globalTrasl = rg.Vector3d( transResult ) 
                globalTrasl.Transform(xform2[1]) 
                globalTrasl.Transform(xform)
                globalTransVector.append( globalTrasl )
    
           
            defpolyline = rg.PolylineCurve( defPoint )
    
            if dimSection[0] == 'circular' :
                radius1  = dimSection[1]/2
                radius2  = dimSection[1]/2 - dimSection[2]
                if (radius1 - radius2 ) == 0:
                    meshdef = meshLoft3( defSection,  color )
    
                else :
                    defSection1 = [row[0] for row in defSection ]
                    defSection2 = [row[1] for row in defSection ]
                    meshdef = meshLoft3( defSection1,  color )
                    meshdef.Append( meshLoft3( defSection2,  color ) )
                    print( meshdef )
    
            else  :
                meshdef = meshLoft3( defSection,  color )
            return  [  defpolyline, meshdef ,  globalTransVector, globalRotVector ] 
    
        ## node e nodeDisp son dictionary ##
        def defTruss( ele, node, nodeDisp, scale ):
            WorldPlane = rg.Plane.WorldXY
            TagEle = ele[0]
            propSection = ele[2]
            color = propSection[12]
            indexStart = ele[1][0]
            indexEnd = ele[1][1]
            E = propSection[1]
            A = propSection[3]
            
            traslStart = nodeDisp.get( indexStart -1 , "never")
            traslEnd = nodeDisp.get( indexEnd -1 , "never")
            if len( traslStart ) == 2:
                traslStart = nodeDisp.get( indexStart -1 , "never")[0]
                traslEnd = nodeDisp.get( indexEnd -1 , "never")[0]
            pointStart = node.get( indexStart -1 , "never")
            pointEnd = node.get( indexEnd -1 , "never")
            #print( traslStart[1] )
            line = rg.LineCurve( pointStart,  pointEnd )
    
            axis1 =  rg.Vector3d( propSection[9][0][0], propSection[9][0][1], propSection[9][0][2]  )
            axis2 =  rg.Vector3d( propSection[9][1][0], propSection[9][1][1], propSection[9][1][2]  )
            axis3 =  rg.Vector3d( propSection[9][2][0], propSection[9][2][1], propSection[9][2][2]  )
            versor = [ axis1, axis2, axis3 ] 
            #---------- WORLD PLANE on point start of line ---------------#
            traslPlane = rg.Transform.Translation( pointStart.X, pointStart.Y, pointStart.Z )
            WorldPlane.Transform( traslPlane )
            #-------------------------------------------------------------#
            planeStart = rg.Plane(pointStart, axis1, axis2 )
            #planeStart = rg.Plane(pointStart, axis3 )
            localPlane = planeStart
            xform = rg.Transform.ChangeBasis( WorldPlane, localPlane )
            localTraslStart = rg.Vector3d( traslStart )
            vectorTrasform = rg.Transform.TransformList( xform, [ traslStart , traslEnd ] )
            #print( vectorTrasform[0] )
            localTraslStart = vectorTrasform[0]
            uI1 = localTraslStart.X # spostamento in direzione dell'asse rosso 
            uI2 = localTraslStart.Y # spostamento in direzione dell'asse verde
            uI3 = localTraslStart.Z # spostamento linea d'asse
            localTraslEnd = vectorTrasform[1]
            uJ1 = localTraslEnd.X # spostamento in direzione dell'asse rosso 
            uJ2 = localTraslEnd.Y # spostamento in direzione dell'asse verde
            uJ3 = localTraslEnd.Z # spostamento linea d'asse
            ##-------------- displacement value -------------------------##
            Length = rg.Curve.GetLength( line )
            segmentCount = Length/0.5
            DivCurve = line.DivideByCount( segmentCount, True )
            if DivCurve == None:
                DivCurve = [ 0, Length]
            defPoint = []
            defSection = []
            globalTransVector = []
            #----------------------- local to global-------------------------#
            xform2 = xform.TryGetInverse()
            #----------------------------------------------------------------#
            for index, x in enumerate(DivCurve):
                beamPoint = line.PointAt(DivCurve[index]) 
                ## SPOSTAMENTO IN DIREZIONE DELL' ASSE 3 ##
                u3 = spostu(x, Length, uI3, uJ3)
                u3Vector = u3*axis3
                ## SPOSTAMENTO IN DIREZIONE DELL' ASSE 1 ##
                v1 =  x*( uJ1 - uI1 )/Length + uI1
                v1Vector = v1*axis1 
                ## SPOSTAMENTO IN DIREZIONE DELL' ASSE 2 ##
                v2 =  x*( uJ2 - uI2 )/Length + uI2
                v2Vector = v2*axis2 
                ## RISULTANTE SPOSTAMENTI ##
                transResult = v1Vector + v2Vector + u3Vector
                trasl = rg.Transform.Translation( transResult*scale )
                beamPoint.Transform( trasl )
                defPoint.append( beamPoint )
                sectionPlane = rg.Plane( beamPoint, axis1, axis2 )
                if dimSection[0] == 'rectangular' :
                    width, height = dimSection[1], dimSection[2]
                    section = AddRectangleFromCenter( sectionPlane, width, height )
                    defSection.append( section )
                elif dimSection[0] == 'circular' :
                    radius1  = dimSection[1]/2
                    radius2  = dimSection[1]/2 - dimSection[2]
                    section1 = AddCircleFromCenter( sectionPlane, radius1 )
                    if (radius1 - radius2 ) == 0 :
                        defSection.append( section1 )
                    else :
                        section2 = AddCircleFromCenter( sectionPlane, radius2 )
                        defSection.append( [ section1, section2 ] )
                elif dimSection[0] == 'doubleT' :
                    Bsup = dimSection[1]
                    tsup = dimSection[2]
                    Binf = dimSection[3]
                    tinf = dimSection[4]
                    H =  dimSection[5]
                    ta =  dimSection[6]
                    yg =  dimSection[7]
                    section = AddIFromCenter( sectionPlane, Bsup, tsup, Binf, tinf, H, ta, yg )
                    defSection.append( section )
                elif dimSection[0] == 'Generic' :
                    radius  = dimSection[1]
                    section = AddCircleFromCenter( sectionPlane, radius )
                    defSection.append( section )
            
                globalTrasl = rg.Vector3d( transResult ) 
                globalTrasl.Transform(xform2[1]) 
                globalTrasl.Transform(xform)
                globalTransVector.append( globalTrasl )
    
           
            defpolyline = rg.PolylineCurve( defPoint )
    
            if dimSection[0] == 'circular' :
                radius1  = dimSection[1]/2
                radius2  = dimSection[1]/2 - dimSection[2]
                if (radius1 - radius2 ) == 0:
                    meshdef = meshLoft3( defSection,  color )
    
                else :
                    defSection1 = [row[0] for row in defSection ]
                    defSection2 = [row[1] for row in defSection ]
                    meshdef = meshLoft3( defSection1,  color )
                    meshdef.Append( meshLoft3( defSection2,  color ) )
                    #print( meshdef )
    
            else  :
                meshdef = meshLoft3( defSection,  color )
            return  [ defpolyline, meshdef, globalTransVector] 
        ## Mesh from close section eith gradient color ##
        def meshLoft3( point, color ):
            #print( point )
            meshEle = rg.Mesh()
            pointSection1 = point
            for i in range(0,len(pointSection1)):
                for j in range(0, len(pointSection1[0])):
                    vertix = pointSection1[i][j]
                    #print( type(vertix) )
                    meshEle.Vertices.Add( vertix ) 
                    #meshEle.VertexColors.Add( color[0],color[1],color[2] );
            k = len(pointSection1[0])
            for i in range(0,len(pointSection1)-1):
                for j in range(0, len(pointSection1[0])):
                    if j < k-1:
                        index1 = i*k + j
                        index2 = (i+1)*k + j
                        index3 = index2 + 1
                        index4 = index1 + 1
                    elif j == k-1:
                        index1 = i*k + j
                        index2 = (i+1)*k + j
                        index3 = (i+1)*k
                        index4 = i*k
                    meshEle.Faces.AddFace(index1, index2, index3, index4)
                    #rs.ObjectColor(scyl,(255,0,0))
            colour = rs.CreateColor( color[0], color[1], color[2] )
            meshEle.VertexColors.CreateMonotoneMesh( colour )
            meshElement = meshEle
            #meshdElement.IsClosed(True)
            
            return meshElement
    
        def gradient(value, valueMin, valueMax, colorList ):
    
            if colorList == [] :
                listcolor = [ rs.CreateColor( 201, 0, 0 ),
                            rs.CreateColor( 240, 69, 7),
                            rs.CreateColor( 251, 255, 0 ),
                            rs.CreateColor( 77, 255, 0 ),
                            rs.CreateColor( 0, 255, 221 ),
                            rs.CreateColor( 0, 81, 255 )]
            else :
                listcolor = colorList
    
            n = len( listcolor )
            domain = linspace( valueMin, valueMax, n)
            #print( domain )
            
            for i in range(1,n+1):
                if  domain[i-1] <= value <= domain[i] :
                    return listcolor[ i-1 ]
                elif  valueMax <= value <= valueMax + 0.0000000000001 :
                    return listcolor[ -1 ]
                elif  valueMin - 0.0000000000001 <= value <= valueMin  :
                    return listcolor[ 0 ]
                    
        def updateComponent(interval):
            
            ## Updates this component, similar to using a grasshopper timer 
            
            # Define callback action
            def callBack(e):
                ghenv.Component.ExpireSolution(False)
            
            # Get grasshopper document
            ghDoc = ghenv.Component.OnPingDocument()
            
            # Schedule this component to expire
            ghDoc.ScheduleSolution(interval,gh.Kernel.GH_Document.GH_ScheduleDelegate(callBack)) # Note that the first input here is how often to update the component (in milliseconds)
                
        def ModalView(AlpacaModalOutput, numberMode, speed, Animate, Reset, scale, direction, modelExtrude, colorList ):
        
            global myCounter
            
            
            Animate = False if Animate is None else Animate
            numberMode = 1 if numberMode is None else numberMode
            Reset = False if Reset is None else Reset
            speed = 1 if speed is None else speed
            modelExtrude = True if modelExtrude is None else modelExtrude
            direction = 3 if direction is None else direction
                    
                
                
            global ModelDisp
            global ModelCurve
            global ModelShell
            global ModelSolid
            global dimSection
            #global ExtrudedModel
        
            diplacementWrapper = AlpacaModalOutput[0][numberMode-1] # number of mode will start from 1. First, Second, Third ect ect
            EleOut = AlpacaModalOutput[1]
            Period = AlpacaModalOutput[3]
        
        
            # Instantiate/reset persisent starting counter variable
            if "myCounter" not in globals() or Reset :
                myCounter = 0
        
            # Update the variable and component
            if Animate and not Reset:
                myCounter += 1/ ( (speed) * 10 )
                updateComponent(1)
        
            # Output counter
        
            T = Period[numberMode-1]
            w = 2 * mt.pi/T
            #At = math.sin(myCounter)
        
            At = mt.sin(myCounter * w + mt.pi/2)
        
            nodeValue = []
            displacementValue = []
            #ShellOut = AlpacaModalOutput[4]
        
            pointWrapper = []
            dispWrapper = []
        
            for index,item in enumerate(diplacementWrapper):
                nodeValue.append( item[0] )
                displacementValue.append( item[1] )
                pointWrapper.append( [index, rg.Point3d(item[0][0],item[0][1],item[0][2]) ] )
                if len(item[1]) == 3:
                    dispWrapper.append( [index, rg.Point3d( item[1][0], item[1][1], item[1][2] ) ] )
                elif len(item[1]) == 6:
                    dispWrapper.append( [index, [rg.Point3d(item[1][0],item[1][1],item[1][2] ), rg.Point3d(item[1][3],item[1][4],item[1][5]) ] ] )
        
            ## Dict. for point ##
            pointWrapperDict = dict( pointWrapper )
            pointDispWrapperDict = dict( dispWrapper )
            ####
        
            ## FOR scala automatica ##
            ## nodeValue è la lista delle cordinate
            rowX = [row[0] for row in nodeValue ]
            rowY = [row[1] for row in nodeValue ]
            rowZ = [row[2] for row in nodeValue ]
        
            scaleMax = max( max(rowX), max(rowY), max(rowZ) )
            scaleMin = min( min(rowX), min(rowY), min(rowZ) )
            coordMax = max( mt.fabs(scaleMin),mt.fabs(scaleMax)) - mt.fabs(scaleMin)
        
            ## displacementValue è la lista degli spostamenti
        
            rowDefX = [row[0] for row in displacementValue ]
            rowDefY = [row[1] for row in displacementValue ]
            rowDefZ = [row[2] for row in displacementValue ]
        
            defMax = max( max(rowDefX), max(rowDefY), max(rowDefZ) )
            defMin = min( min(rowDefX), min(rowDefY), min(rowDefZ) )
            DefMax = max( mt.fabs(defMax),mt.fabs(defMin))
        
            if scale is None:
                scaleDef = scaleAutomatic( coordMax , DefMax )/10
        
            else :
                scaleDef = scale
        
            modelDisp = []
            modelCurve = []
            ShellDefModel = []
            ExtrudedView = []
        
            traslBeamValue = []
            rotBeamValue = []
        
            traslShellValue = []
            rotShellValue = []
            ExtrudedShell = []
        
            SolidDefModel = []
            traslSolidValue = []
        
        
            for ele in EleOut :
                eleType = ele[2][0]
                nNode = len( ele[1] )
                
                if eleType == 'ElasticTimoshenkoBeam' :
                    
                    dimSection = ele[2][10]
                    color = ele[2][12]
                    valueTBeam = defValueTimoshenkoBeam( ele, pointWrapperDict, pointDispWrapperDict, scaleDef*At )
                    defpolyline = valueTBeam[0]
                    meshdef = valueTBeam[1]
                    globalTrans = valueTBeam[2]
                    globalRot = valueTBeam[3]
                    traslBeamValue.append( globalTrans ) 
                    rotBeamValue.append( globalRot )
                    modelCurve.append( defpolyline )
                    modelDisp.append( defpolyline )
                    # estrusione della beam #
                    ExtrudedView.append( meshdef )
                elif eleType == 'Truss' :
                    dimSection = ele[2][10]
                    color = ele[2][12]
                    #print( color )
                    valueTruss = defTruss( ele, pointWrapperDict, pointDispWrapperDict, scaleDef*At )
                    defpolyline = valueTruss[0]
                    meshdef = valueTruss[1]
                    globalTrans = valueTruss[2]
                    traslBeamValue.append( globalTrans ) 
                    modelCurve.append( defpolyline )
                    ExtrudedView.append( meshdef )
                    modelDisp.append( defpolyline )
        
                elif nNode == 4 and eleType != 'FourNodeTetrahedron':
                    shellDefModel = defShellQuad( ele, pointWrapperDict, pointDispWrapperDict, scaleDef*At )
                    ShellDefModel.append( shellDefModel[0] )
                    traslShellValue.append( shellDefModel[1] )
                    rotShellValue.append( shellDefModel[2] )
                    extrudeShell = shellDefModel[3]
                    ExtrudedView.append( extrudeShell )
                    
                elif nNode == 3:
                    #print( nNode )
                    shellDefModel = defShellTriangle( ele, pointWrapperDict, pointDispWrapperDict, scaleDef*At )
                    ShellDefModel.append( shellDefModel[0] )
                    traslShellValue.append( shellDefModel[1] )
                    rotShellValue.append( shellDefModel[2] )
                    extrudeShell = shellDefModel[3]
                    ExtrudedView.append( extrudeShell )
        
                    
                elif nNode == 8:
                    solidDefModel = defSolid( ele, pointWrapperDict, pointDispWrapperDict, scaleDef*At )
                    SolidDefModel.append( solidDefModel[0] )
                    doc.Objects.AddMesh( solidDefModel[0] )
                    traslSolidValue.append( solidDefModel[1] )
                    ExtrudedView.append( solidDefModel[0] )
                    
                elif  eleType == 'FourNodeTetrahedron' :
                    #print(ele)
                    solidDefModel = defTetraSolid( ele, pointWrapperDict, pointDispWrapperDict, scaleDef*At )
                    SolidDefModel.append( solidDefModel[0] )
                    traslSolidValue.append( solidDefModel[1] )
                    ExtrudedView.append( solidDefModel[0] )
        
            ########################################################################################################################
            # MAX an MIN VALOR
            valorVector = []
            # beam valor #
            for valuetrasl in traslBeamValue:
                for valor in valuetrasl:
                    vectorTrasl = rg.Vector3d( valor )
                    if direction == 0:
                        valorVector.append( vectorTrasl.X ) 
                    elif direction == 1:
                        valorVector.append( vectorTrasl.Y )
                    elif direction == 2:
                        valorVector.append( vectorTrasl.Z ) 
                    elif direction == 3:
                        valorVector.append( vectorTrasl.Length )     
            # POINT #
            if len(dispWrapper[0][1]) == 3 :
                PointDisp = [row[1] for row in dispWrapper ] 
            else:
                PointDisp = [row[1][0] for row in dispWrapper ]
        
            for nodeDisp in PointDisp :
                vectorNodeDisp = rg.Vector3d( nodeDisp )
                if direction == 0:
                    valorVector.append( vectorNodeDisp.X ) 
                elif direction == 1:
                    valorVector.append( vectorNodeDisp.Y )
                elif direction == 2:
                    valorVector.append( vectorNodeDisp.Z ) 
                elif direction == 3:
                    valorVector.append( vectorNodeDisp.Length )
            # MAX end MIN on structures point #
            lowerLimit = min( valorVector )
            upperLimit = max( valorVector )
            domainValues = [ lowerLimit, upperLimit ]
            print( lowerLimit, upperLimit )
        #####################################################################################
            colorBeam = []
            numberDivide = []
            for value in traslBeamValue :
                colorValor = []
                for valor in value:
                    vectorTrasl = rg.Vector3d( valor )
        
                    if direction == 0:
                        valorVector = vectorTrasl.X  
                    elif direction == 1:
                        valorVector = vectorTrasl.Y 
                    elif direction == 2:
                        valorVector = vectorTrasl.Z  
                    elif direction == 3:
                        valorVector = vectorTrasl.Length
        
                    #print( valorVector )
        
                    color = gradient( valorVector, lowerLimit, upperLimit, colorList )
                    colorValor.append( color )
                colorBeam.append( colorValor )
                numberDivide.append( len(colorValor) )
            #print( modelCurve[0])
            segment = []
            for curve, segmentCount in zip( modelCurve, numberDivide ):
                #print(segmentCount)
                parameter = curve.DivideByCount( segmentCount - 1, True )
                segmentCurve = []
                for i in range(1, len(parameter)) :
                        p1 =  rg.Curve.PointAt( curve, parameter[i-1] ) 
                        p2 = rg.Curve.PointAt( curve, parameter[i] )
                        segmentCurve.append( rg.Line( p1, p2 ) )
                segment.append( segmentCurve )
        
                #print( segment )
        
            
            for shellEle, value in zip(ShellDefModel,traslShellValue) :
                shellColor = shellEle.DuplicateMesh()
                shellColor.VertexColors.Clear()
                for j in range( 0,shellEle.Vertices.Count ):
                    vectorTrasl = rg.Vector3d( value[j] )
                    if direction == 0:
                        valorVector = vectorTrasl.X  
                    elif direction == 1:
                        valorVector = vectorTrasl.Y 
                    elif direction == 2:
                        valorVector = vectorTrasl.Z  
                    elif direction == 3:
                        valorVector = vectorTrasl.Length
        
                    color = gradient( valorVector, lowerLimit, upperLimit, colorList )
                    shellColor.VertexColors.Add( color )
                modelDisp.append( shellColor)
            #dup.VertexColors.CreateMonotoneMesh(Color.Red)
            #doc.Objects.AddMesh(dup)
            for solidEle, value in zip(SolidDefModel,traslSolidValue) :
                solidColor = solidEle.DuplicateMesh()
                solidColor.VertexColors.Clear()
                for j in range(0,solidEle.Vertices.Count):
                    vectorTrasl = rg.Vector3d( value[j] )
                    if direction == 0:
                        valorVector = vectorTrasl.X  
                    elif direction == 1:
                        valorVector = vectorTrasl.Y 
                    elif direction == 2:
                        valorVector = vectorTrasl.Z  
                    elif direction == 3:
                        valorVector = vectorTrasl.Length
        
                    color = gradient( valorVector, lowerLimit, upperLimit, colorList )
                    solidColor.VertexColors.Add( color )
                modelDisp.append( solidColor )
                    #rg.Collections.MeshVertexColorList.SetColor( solidEle,j, color[0], color[1], color[2] )
        
        
            if modelExtrude == False or modelExtrude == None :
                self.line = segment
                self.colorLine = colorBeam
                return modelDisp
                
            else:
                self.line = []
                self.colorLine = []
                return ExtrudedView
                
                
                
        checkData = True
        
        if not AlpacaModalOutput:
            checkData = False
            msg = "input 'AlpacaModalOutput' failed to collect data"
            ghenv.Component.AddRuntimeMessage(gh.Kernel.GH_RuntimeMessageLevel.Warning, msg)
        
        if checkData != False:
            modelDisp = ModalView(AlpacaModalOutput, numberMode, speed, Animate, Reset, scale, direction,modelExtrude, colorList )
            return (modelDisp)
            
    def DrawViewportWires(self,arg):
        
        for crvs, colors in zip(self.line, self.colorLine):
            for crv, color in zip(crvs, colors):
                arg.Display.DrawLine(crv, color, 4)
# ---------- end ghpython_script_17 ----------

# ----
geometry = Geometry(ghpython_script_17)
