# Grasshopper definition 200401_GHPython_DrawViewportWires_02.gh (Grasshopper 1.0.7)

# ---- group: Draw Curves with Custom Weights
thickness = Slider(5, range=0..20)  # disabled
swatch = ColourSwatch(SwatchColor=RGB(0, 207, 255))  # disabled
crv = Curve([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])
dc = DrawCurves(Curves=crv, Weight=thickness, Color=swatch)  # inputs Curves: list; disabled
# ---------- dc: Python ----------
"""
Minimal working prototype for implementing DrawViewportWires in GHPython.
    Inputs:
        Curves: Curves to render {list,curve}
        Weight: {item,int}
        Color: {item,color}
    Outputs:
    Remarks:
        Author: Anders Holden Deleuran (BIG IDEAS)
        Rhino: 6.24.20079.23341
        Version: 200401
"""

ghenv.Component.Name = "DrawCurves"
ghenv.Component.NickName = "DC"

from ghpythonlib.componentbase import executingcomponent as component
import Rhino as rc

class MyComponent(component):
    
    def RunScript(self,Curves,Weight,Color):
        self.curves = Curves
        self.weight = Weight
        self.color = Color
        
    def DrawViewportWires(self,arg):
        for crv in self.curves:
            arg.Display.DrawCurve(crv,self.color,self.weight)
# ---------- end dc ----------

# ---- group: Draw Flat Shaded Two-Sided Mesh with Custom Wire Thickness/Color
number_slider = Slider(3, range=0..10)  # disabled
swatch_2 = ColourSwatch(SwatchColor=RGB(235, 235, 235))  # disabled
swatch_3 = ColourSwatch(SwatchColor=RGB(255, 127, 0))  # disabled
swatch_4 = ColourSwatch(SwatchColor=RGB(0, 0, 0))  # disabled
mesh = Mesh(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)  # disabled
dmf = DrawMeshFlat(Mesh=mesh, FrontColor=swatch_2, BackColor=swatch_3, EdgeColor=swatch_4, EdgeWidth=number_slider)  # disabled
# ---------- dmf: Python ----------
"""
How to add to rendered display mode.
https://discourse.mcneel.com/t/grasshopper-mesh-rendering-preview-in-c/82069
"""

ghenv.Component.Name = "DrawMeshFlat"
ghenv.Component.NickName = "DMF"

from ghpythonlib.componentbase import executingcomponent as component
import Rhino as rc
from System.Drawing import Color

class MyComponent(component):
    
    def RunScript(self,Mesh,FrontColor,BackColor,EdgeColor,EdgeWidth):
        self.mesh = Mesh
        self.edgeColor = EdgeColor
        self.edgeWidth = EdgeWidth
        
        # Set front colors
        self.material = rc.Display.DisplayMaterial(Color.Black)
        self.material.Emission = FrontColor
        
        # Color back faces
        if BackColor:
            self.material.IsTwoSided = True
            self.material.BackDiffuse = Color.Black
            self.material.BackEmission = BackColor
            
    def DrawViewportMeshes(self,arg):
        arg.Display.DrawMeshShaded(self.mesh,self.material)
        
    def DrawViewportWires(self,arg):
        arg.Display.DrawMeshWires(self.mesh,self.edgeColor,self.edgeWidth)
# ---------- end dmf ----------

# ---- group: Draw Curves with Custom Weights
thickness_2 = Slider(7, range=0..20)  # disabled
swatch_5 = ColourSwatch(SwatchColor=RGB(168, 0, 0))  # disabled
crv_2 = Curve([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])  # disabled
dc_2 = DrawCurves(Curves=crv_2, Weight=thickness_2, Color=swatch_5)  # inputs Curves: list; disabled
# ---------- dc_2: Python ----------
"""
Minimal working prototype for implementing DrawViewportWires in GHPython.
    Inputs:
        Curves: Curves to render {list,curve}
        Weight: {item,int}
        Color: {item,color}
    Outputs:
    Remarks:
        Author: Anders Holden Deleuran (BIG IDEAS)
        Rhino: 6.24.20079.23341
        Version: 200401
"""

ghenv.Component.Name = "DrawCurves"
ghenv.Component.NickName = "DC"

from ghpythonlib.componentbase import executingcomponent as component
import Rhino as rc
import Rhino.Geometry as rg


class MyComponent(component):
    
    def RunScript(self,Curves,Weight,Color):
        self.curves = Curves
        self.weight = Weight
        self.color = Color
       
        Point = []
        for i in range(0,20):
            Point.append(rg.Point3d(i,0,0))
        
        self.points = Point
        
    def DrawViewportWires(self,arg):
        for crv in self.curves:
            arg.Display.DrawCurve(crv,self.color,self.weight)
        
        for point in self.points:
            arg.Display.DrawPoint(point)
# ---------- end dc_2 ----------

# ----
number_slider_2 = Slider(109, range=0..1000)  # disabled
number_slider_3 = Slider(0, range=0..1000)  # disabled
number_slider_4 = Slider(224, range=0..1000)  # disabled
number_slider_5 = Slider(398, range=0..1000)  # disabled

# ---- group: Draw 2D Text in Screen Space
# Create by
# Anders - BIG IDeas
panel = Panel("""Ham:
- Foo
- Bar
- Jeff
- Britta
- 100%""")
pt = Point(Point(100, 100, 0))  # disabled
dst = DrawScreenText(Text=panel, Color=ColourSwatch(SwatchColor=RGB(0, 0, 0)), Height=Slider(30, range=0..30), Point=pt, Font="Iosevka")  # disabled
# ---------- dst: Python ----------
from ghpythonlib.componentbase import executingcomponent as component
import Rhino as rc
import System

ghenv.Component.Name = "DrawScreenText"
ghenv.Component.NickName = "DST"

class MyComponent(component):
    
    def RunScript(self,Text,Color,Height,Point,Font):
        self.text = Text
        self.color = Color
        self.height = Height
        self.point = rc.Geometry.Point2d(Point.X,Point.Y)
        self.font = Font
        
        
    def DrawViewportWires(self,arg):
        arg.Display.Draw2dText(self.text,self.color,self.point,False,self.height,self.font)
# ---------- end dst ----------

# ----
sph = Sphere(Base=PlaneXY(0, 0, 0), Radius=1)  # disabled
panel_2 = Panel("10")  # disabled
panel_3 = Panel("2")  # disabled
cyl = Cylinder(Base=PlaneXY(0, 0, 0), Radius=0.5, Length=panel_2)  # disabled
flip = Flip(Surface=sph)  # -> Surface, Result; disabled
pi = Pi(Factor=panel_3)  # disabled
cap = CapHoles(Brep=cyl)  # disabled
panel_4 = Panel("20")  # disabled
sunion = SolidUnion(Breps=flip.Surface)  # disabled
range = Range(Domain=pi, Steps=panel_4)  # disabled
cos = Cosine(Value=range)  # disabled
brep = Brep(sunion)  # disabled
number_slider_6 = Slider(10, range=1..10)  # disabled
vec = VectorXYZ(XComponent=range, YComponent=range, ZComponent=cos)  # -> Vector, Length; disabled
multiplication = Multiplication(A=vec.Vector, B=number_slider_6)  # disabled
move = Move(Geometry=brep, Motion=multiplication)  # -> Geometry, Transform; disabled

sph_2 = Sphere(Base=PlaneXY(0, 0, 0), Radius=1)

range_2 = Range(Domain="0.10 to 2.0", Steps=10)
clr = ColorsAlpaca4d(gradIndex=Slider(11, range=0..12))  # -> colors; inputs gradIndex: Int32
#   port colors: A series of colors to be plugged into the "Ladybug_Legend Parameters" component.
# ---------- clr: Python ----------
"""
Preset of gradient colors perfect for Data Visualisation
    Inputs:
        gradIndex: An index refering to one of the following possible gradients:
            0 - Orignal Ladybug
            1 - Nuanced Ladybug
            2 - Multi-colored Ladybug
            3 - Ecotect
            4 - Thermal Comfort Percentage
            5 - Thermal Comfort Colors
            6 - Shade Benefit/Harm
            7 - Shade Harm
            8 - Shade Benefit
            9 - CFD Colors 1
            10 - Radiation Benefit
            11 - Gsa10 Colour
            12 - Gsa9 Colour
    Returns:
        customColors: A series of colors.
"""

ghenv.Component.Name = "Colors (Alpaca4d)"
ghenv.Component.NickName = 'CLR'
ghenv.Component.Message = 'Colors (Alpaca4d)'

import scriptcontext as sc
import Grasshopper.Kernel as gh
import System

gradientLibrary = {
        0: [System.Drawing.Color.FromArgb(75, 107, 169), System.Drawing.Color.FromArgb(115, 147, 202), System.Drawing.Color.FromArgb(170, 200, 247), System.Drawing.Color.FromArgb(193, 213, 208), System.Drawing.Color.FromArgb(245, 239, 103), System.Drawing.Color.FromArgb(252, 230, 74), System.Drawing.Color.FromArgb(239, 156, 21), System.Drawing.Color.FromArgb(234, 123, 0), System.Drawing.Color.FromArgb(234, 74, 0), System.Drawing.Color.FromArgb(234, 38, 0)],
        1: [System.Drawing.Color.FromArgb(49,54,149), System.Drawing.Color.FromArgb(69,117,180), System.Drawing.Color.FromArgb(116,173,209), System.Drawing.Color.FromArgb(171,217,233), System.Drawing.Color.FromArgb(224,243,248), System.Drawing.Color.FromArgb(255,255,191), System.Drawing.Color.FromArgb(254,224,144), System.Drawing.Color.FromArgb(253,174,97), System.Drawing.Color.FromArgb(244,109,67), System.Drawing.Color.FromArgb(215,48,39), System.Drawing.Color.FromArgb(165,0,38)],
        2: [System.Drawing.Color.FromArgb(4,25,145), System.Drawing.Color.FromArgb(7,48,224), System.Drawing.Color.FromArgb(7,88,255), System.Drawing.Color.FromArgb(1,232,255), System.Drawing.Color.FromArgb(97,246,156), System.Drawing.Color.FromArgb(166,249,86), System.Drawing.Color.FromArgb(254,244,1), System.Drawing.Color.FromArgb(255,121,0), System.Drawing.Color.FromArgb(239,39,0), System.Drawing.Color.FromArgb(138,17,0)],
        3: [System.Drawing.Color.FromArgb(0,0,255), System.Drawing.Color.FromArgb(53,0,202), System.Drawing.Color.FromArgb(107,0,148), System.Drawing.Color.FromArgb(160,0,95), System.Drawing.Color.FromArgb(214,0,41), System.Drawing.Color.FromArgb(255,12,0), System.Drawing.Color.FromArgb(255,66,0), System.Drawing.Color.FromArgb(255,119,0), System.Drawing.Color.FromArgb(255,173,0), System.Drawing.Color.FromArgb(255,226,0), System.Drawing.Color.FromArgb(255,255,0)],
        4: [System.Drawing.Color.FromArgb(0,0,0), System.Drawing.Color.FromArgb(110,0,153), System.Drawing.Color.FromArgb(255,0,0), System.Drawing.Color.FromArgb(255,255,102), System.Drawing.Color.FromArgb(255,255,255)],
        5: [System.Drawing.Color.FromArgb(0,136,255), System.Drawing.Color.FromArgb(200,225,255), System.Drawing.Color.FromArgb(255,255,255), System.Drawing.Color.FromArgb(255,230,230), System.Drawing.Color.FromArgb(255,0,0)],
        6: [System.Drawing.Color.FromArgb(5,48,97), System.Drawing.Color.FromArgb(33,102,172), System.Drawing.Color.FromArgb(67,147,195), System.Drawing.Color.FromArgb(146,197,222), System.Drawing.Color.FromArgb(209,229,240), System.Drawing.Color.FromArgb(255,255,255), System.Drawing.Color.FromArgb(253,219,199), System.Drawing.Color.FromArgb(244,165,130), System.Drawing.Color.FromArgb(214,96,77), System.Drawing.Color.FromArgb(178,24,43), System.Drawing.Color.FromArgb(103,0,31)],
        7: [System.Drawing.Color.FromArgb(255,255,255), System.Drawing.Color.FromArgb(253,219,199), System.Drawing.Color.FromArgb(244,165,130), System.Drawing.Color.FromArgb(214,96,77), System.Drawing.Color.FromArgb(178,24,43), System.Drawing.Color.FromArgb(103,0,31)],
        8: [System.Drawing.Color.FromArgb(255,255,255), System.Drawing.Color.FromArgb(209,229,240), System.Drawing.Color.FromArgb(146,197,222), System.Drawing.Color.FromArgb(67,147,195), System.Drawing.Color.FromArgb(33,102,172), System.Drawing.Color.FromArgb(5,48,97)],
        9: [System.Drawing.Color.FromArgb(0,16,120), System.Drawing.Color.FromArgb(38,70,160), System.Drawing.Color.FromArgb(5,180,222), System.Drawing.Color.FromArgb(16,180,109), System.Drawing.Color.FromArgb(59,183,35), System.Drawing.Color.FromArgb(143,209,19), System.Drawing.Color.FromArgb(228,215,29), System.Drawing.Color.FromArgb(246,147,17), System.Drawing.Color.FromArgb(243,74,0), System.Drawing.Color.FromArgb(255,0,0)],
        10: [System.Drawing.Color.FromArgb(0,191,48), System.Drawing.Color.FromArgb(255,238,184), System.Drawing.Color.FromArgb(255,0,0)],
        11: [System.Drawing.Color.FromArgb(204,0,71), System.Drawing.Color.FromArgb(255,182,71), System.Drawing.Color.FromArgb(206,255,115), System.Drawing.Color.FromArgb(26,180, 214),System.Drawing.Color.FromArgb(0,0,207)],
        12: [System.Drawing.Color.FromArgb(255, 51, 51), System.Drawing.Color.FromArgb(255, 170, 51), System.Drawing.Color.FromArgb(255, 255, 51), System.Drawing.Color.FromArgb(170, 255, 125), System.Drawing.Color.FromArgb(51, 255, 231), System.Drawing.Color.FromArgb(51, 170, 255), System.Drawing.Color.FromArgb(51,51, 255)]}
colors = gradientLibrary[gradIndex]
# ---------- end clr ----------
structural_output = Number(range_2)
number_slider_7 = Slider(2, range=0..2)
number_slider_8 = Slider(1.48, range=0.5..2)
dst_2 = DrawScreenText()  # inputs Data: list, Colors: list, Pos: Int32
# ---------- dst_2: Python ----------
"""Visualise a legend on screen
    Inputs:
        Title:
        Data:
        Colors:
        Pos:
        Scale:
    Output:
        """





from ghpythonlib.componentbase import executingcomponent as component
import Rhino as rc
import System


ghenv.Component.Name = "DrawScreenText"
ghenv.Component.NickName = "DST"

class MyComponent(component):

    def RunScript(self,Title,Data,Colors,Pos,Scale):
        # Assign input variables
        
        self.title = Title
        self.col = Colors
        self.scale = Scale
        self.data = Data
        
        
        self.pos = 2 if Pos is None else Pos
        
        RhinoDocument = rc.RhinoDoc.ActiveDoc
        self.active_view = RhinoDocument.Views.ActiveView

        self.black = System.Drawing.Color.Black
        
        if not self.scale:
            self.scale = 1.5
        
        if self.data:
            self.min_number = float(min(self.data))
            self.max_number = float(max(self.data))
        else:
            self.min_number = -1.0
            self.max_number = 1.0
        
        if not self.col:
            self.col = [System.Drawing.Color.FromArgb(255, 51, 51), System.Drawing.Color.FromArgb(255, 170, 51), System.Drawing.Color.FromArgb(255, 255, 51), System.Drawing.Color.FromArgb(170, 255, 125), System.Drawing.Color.FromArgb(51, 255, 231), System.Drawing.Color.FromArgb(51, 170, 255), System.Drawing.Color.FromArgb(51,51, 255)]
        
        
        self.diff = self.max_number - self.min_number
        
        self.range = len(self.col) + 1



    def DrawViewportWires(self,arg):
        
        
        width = self.active_view.Size.Width
        height = self.active_view.Size.Height
        
        anchor_y = height * 0.075
        
        
        if self.pos == 0:
            anchor_x = width * 0.025
        elif self.pos == 1:
            anchor_x = width * (1- 0.125)
        elif self.pos == 2:
            anchor_x = width * 0.5
            anchor_y = height * (1 - 0.125)
        
        
        
        
        
        rect_x = 20 * self.scale
        rect_y = 20 * self.scale
        
        txt_height = rect_y * 0.6
        title_height = rect_y * 0.9
        
        
        
        # Vertical Gradient
        if self.pos == 0 or self.pos == 1:
        
        # Title
            pt = rc.Geometry.Point2d(anchor_x, anchor_y - 3/(1.6) * txt_height)
            arg.Display.Draw2dText(self.title ,self.black,pt,False,title_height,"Arial")
        
            for i,col in enumerate(self.col):
                
                
                # Rectangle is drawn in front of mesh
                rec2d = System.Drawing.Rectangle(anchor_x,anchor_y + i * rect_y, rect_x,rect_y)
                arg.Display.Draw2dRectangle(rec2d,self.black,3,col)


                value = self.diff * i/self.range + self.min_number
                value = "{:.1f}".format(value)
                
                # Text is drawn in front of mesh
                pt = rc.Geometry.Point2d(anchor_x + 1.5 * rect_x, anchor_y - 1/(1.6*2) * txt_height + i * rect_y)
                
                arg.Display.Draw2dText(value,self.black,pt,False,txt_height,"Arial")
            
            i += 1
            pt = rc.Geometry.Point2d(anchor_x + 1.5 * rect_x, anchor_y - 1/(1.6*2) * txt_height + i * rect_y)
            value = "{:.1f}".format(self.max_number)
            arg.Display.Draw2dText(value,self.black,pt,False,txt_height,"Arial")

        # Horizontal Gradient
        if self.pos == 2:
        
        # Title
            pt = rc.Geometry.Point2d(anchor_x, anchor_y - 3/(1.6) * txt_height)
            arg.Display.Draw2dText(self.title,self.black,pt,False,title_height,"Arial")
            
            
            for i,col in enumerate(self.col):
                
                # Rectangle is drawn in front of mesh
                rec2d = System.Drawing.Rectangle(anchor_x + i * rect_x, anchor_y, rect_x,rect_y)
                arg.Display.Draw2dRectangle(rec2d,self.black,3,col)


                value = self.diff * i/self.range + self.min_number
                value = "{:.1f}".format(value)
                
                # Text is drawn in front of mesh
                #pt = rc.Geometry.Point2d(anchor_x + 1.5 * rect_x, anchor_y - 1/(1.6*2) * txt_height + i * rect_y)
                pt = rc.Geometry.Point2d(anchor_x - 1/(1.6) * txt_height + i * rect_x, anchor_y + 3/(1.2) * txt_height)
                arg.Display.Draw2dText(value,self.black,pt,False,txt_height/1.4,"Arial")
            
            i += 1
            pt = rc.Geometry.Point2d(anchor_x - 1/(1.2) * txt_height + i * rect_x, anchor_y + 3/(1.2) * txt_height)
            value = "{:.1f}".format(self.max_number)
            arg.Display.Draw2dText(value,self.black,pt,False,txt_height/1.4,"Arial")
# ---------- end dst_2 ----------

pt_2 = ConstructPoint(XCoordinate=number_slider_2, YCoordinate=number_slider_3, ZCoordinate=0)  # disabled
pt_3 = ConstructPoint(XCoordinate=number_slider_4, YCoordinate=number_slider_5, ZCoordinate=0)  # disabled
clr_2 = ColorsAlpaca4d(gradIndex=11)  # -> colors; inputs gradIndex: Int32; disabled; same code as clr

# ---- group: Draw 2D Rectangle in Screen Space
number_slider_9 = Slider(30, range=0..30)  # disabled
panel_5 = Panel("Iosevka")  # disabled
swatch_6 = ColourSwatch(SwatchColor=RGB(0, 0, 0))  # disabled
pt_4 = Point(pt_2)  # disabled
dst_3 = DrawScreenText(Color=swatch_6, Height=number_slider_9, Point=pt_4, Font=panel_5, colors=clr_2)  # inputs colors: list of Color; disabled
# ---------- dst_3: Python ----------
from ghpythonlib.componentbase import executingcomponent as component
import Rhino as rc
import System

ghenv.Component.Name = "DrawScreenText"
ghenv.Component.NickName = "DST"

class MyComponent(component):
    
    def RunScript(self,Text,Color,Height,Point,Font,colors):
        
        
        self.anchor_x = Point.X
        self.anchor_y = Point.Y
        
        self.dimension_x = 30
        self.dimension_y = 20
        
        #self.rectangle = System.Drawing.Rectangle(anchor_x, anchor_y, dimension_x,dimension_y)
        
        self.stroke = System.Drawing.Color.Black
        self.fillColor = System.Drawing.Color.Red
        
        self.colors = colors
        


        
    def DrawViewportWires(self,arg):
        
        
        
        self.rectangle = System.Drawing.Rectangle(self.anchor_x, self.anchor_y, self.dimension_x, self.dimension_y)
        self.rectangle_2 = System.Drawing.Rectangle(self.anchor_x, self.anchor_y + self.dimension_y, self.dimension_x, self.dimension_y)
        
        self.Rect = [self.rectangle, self.rectangle_2]
        
        
        for i,rect in enumerate(self.Rect):
            
            arg.Display.Draw2dRectangle(rect, self.stroke, 1, self.colors[i])
# ---------- end dst_3 ----------

# ----
clr_3 = ColorsAlpaca4d(gradIndex=11)  # -> colors; inputs gradIndex: Int32; disabled; same code as clr

# ---- group: Draw 2D Rectangle in Screen Space
number_slider_10 = Slider(30, range=0..30)  # disabled
panel_6 = Panel("Iosevka")  # disabled
swatch_7 = ColourSwatch(SwatchColor=RGB(0, 0, 0))  # disabled
pt_5 = Point(pt_3)  # disabled
dst_4 = DrawScreenText(Color=swatch_7, Height=number_slider_10, Point=pt_5, Font=panel_6, colors=clr_3)  # inputs colors: list of Color; disabled
# ---------- dst_4: Python ----------
from ghpythonlib.componentbase import executingcomponent as component
import Rhino as rc
import System

ghenv.Component.Name = "DrawScreenText"
ghenv.Component.NickName = "DST"

class MyComponent(component):
    
    def RunScript(self,Text,Color,Height,Point,Font,colors):
        
        
        self.anchor_x = Point.X
        self.anchor_y = Point.Y
        
        self.dimension_x = 30
        self.dimension_y = 20
        
        #self.rectangle = System.Drawing.Rectangle(anchor_x, anchor_y, dimension_x,dimension_y)
        
        self.stroke = System.Drawing.Color.Black
        self.fillColor = System.Drawing.Color.Blue
        
        self.colors = colors


        
    def DrawViewportWires(self,arg):
        

        
        self.rectangle = System.Drawing.Rectangle(self.anchor_x, self.anchor_y, self.dimension_x, self.dimension_y)
        self.rectangle_2 = System.Drawing.Rectangle(self.anchor_x, self.anchor_y + self.dimension_y, self.dimension_x, self.dimension_y)
        
        
        arg.Display.Draw2dRectangle(self.rectangle, self.stroke, 3, self.fillColor)
        arg.Display.Draw2dRectangle(self.rectangle_2, self.stroke, 3, self.fillColor)
# ---------- end dst_4 ----------

# ----
# Original
swatch_8 = ColourSwatch(SwatchColor=RGB(255, 225, 0))
python = GhPythonScript(Text="Bar", Color=swatch_8)
# ---------- python: Python ----------
import System
import Rhino as rc
from ghpythonlib.componentbase import executingcomponent as component

class MyComponent(component):
        
    def RunScript(self,Text,Color):
        
        # Assign input variables
        self.txt = Text
        self.col = Color
        self.black = System.Drawing.Color.Black
        
    def DrawForeground(self,sender,arg):
        if self.drawingWires:
            self.drawingWires = False
            
            
            anchor_x = 30
            anchor_y = 30
            
            rect_x = 100
            rect_y = 75
            
            txt_height = 120
            
            # Rectangle is drawn in front of mesh
            rec2d = System.Drawing.Rectangle(anchor_x,anchor_y,rect_x,rect_y)
            arg.Display.Draw2dRectangle(rec2d,self.black,3,self.col)

            # Text is drawn in front of mesh
            pt = rc.Geometry.Point2d(anchor_x + rect_x, anchor_y)
            arg.Display.Draw2dText(self.txt,self.black,pt,False,txt_height,"Consolas")




    def DrawViewportWires(self,arg):
        self.drawingWires = True
        
    def __exit__(self):
        rc.Display.DisplayPipeline.DrawForeground -= self.DrawForeground
        
    def __enter__(self):
        rc.Display.DisplayPipeline.DrawForeground += self.DrawForeground
# ---------- end python ----------

panel_7 = Panel("Titl")

# ---- group: Draw Curves with Custom Weights
dc_3 = DrawCurves(Brep=move.Geometry)  # inputs Brep: list of Brep; disabled
# ---------- dc_3: Python ----------
"""
Minimal working prototype for implementing DrawViewportWires in GHPython.
    Inputs:
        Curves: Curves to render {list,curve}
        Weight: {item,int}
        Color: {item,color}
    Outputs:
    Remarks:
        Author: Anders Holden Deleuran (BIG IDEAS)
        Rhino: 6.24.20079.23341
        Version: 200401
"""

ghenv.Component.Name = "DrawCurves"
ghenv.Component.NickName = "DC"

from ghpythonlib.componentbase import executingcomponent as component
import Rhino as rc
import Rhino.Geometry as rg
import System


class MyComponent(component):
    
    def RunScript(self,Brep):
        self.Brep = Brep
        self.material = rc.Display.DisplayMaterial(System.Drawing.Color.Chocolate, 0)
        
    def DrawViewportWires(self,arg):
        for item in self.Brep:
            arg.Display.DrawBrepShaded(item,self.material)
# ---------- end dc_3 ----------

# ----
python_2 = GhPythonScript(Text="Bar", Color=ColourSwatch(SwatchColor=RGB(255, 225, 0)))
# ---------- python_2: Python ----------
import System
import Rhino as rc
from ghpythonlib.componentbase import executingcomponent as component

class MyComponent(component):
        
    def RunScript(self,Text,Color):
        
        # Assign input variables
        self.txt = Text
        self.col = Color
        self.black = System.Drawing.Color.Black
        
    def DrawForeground(self,sender,arg):
        if self.drawingWires:
            self.drawingWires = False
            
            
            anchor_x = 30
            anchor_y = 120
            
            rect_x = 30
            rect_y = 20
            
            #txt_height = 50
            txt_height = rect_y * 1.1
            
            
            # Rectangle is drawn in front of mesh
            rec2d = System.Drawing.Rectangle(anchor_x,anchor_y,rect_x,rect_y)
            arg.Display.Draw2dRectangle(rec2d,self.black,3,self.col)

            # Text is drawn in front of mesh
            pt = rc.Geometry.Point2d(anchor_x + 1.1 * rect_x, anchor_y - 1/(1.6*2) * txt_height)
            arg.Display.Draw2dText(self.txt,self.black,pt,False,txt_height,"Consolas")




            # Rectangle is drawn in front of mesh
            rec2d = System.Drawing.Rectangle(anchor_x,anchor_y + rect_y, rect_x,rect_y)
            arg.Display.Draw2dRectangle(rec2d,self.black,3,self.col)

            # Text is drawn in front of mesh
            pt = rc.Geometry.Point2d(anchor_x + 1.1 * rect_x, anchor_y - 1/(1.6*2) * txt_height + rect_y)
            arg.Display.Draw2dText(self.txt,self.black,pt,False,txt_height,"Consolas")






            # Rectangle is drawn in front of mesh
            rec2d = System.Drawing.Rectangle(anchor_x,anchor_y + rect_y + rect_y, rect_x,rect_y)
            arg.Display.Draw2dRectangle(rec2d,self.black,3,self.col)

            # Text is drawn in front of mesh
            pt = rc.Geometry.Point2d(anchor_x + 1.1 * rect_x, anchor_y - 1/(1.6*2) * txt_height + rect_y + rect_y)
            arg.Display.Draw2dText(self.txt,self.black,pt,False,txt_height,"Consolas")






    def DrawViewportWires(self,arg):
        self.drawingWires = True
        
    def __exit__(self):
        rc.Display.DisplayPipeline.DrawForeground -= self.DrawForeground
        
    def __enter__(self):
        rc.Display.DisplayPipeline.DrawForeground += self.DrawForeground
# ---------- end python_2 ----------

mstb = MeshSeriesToBrickAlpaca4d()  # -> Brick; inputs MeshSeries: list of Mesh, Closed: Boolean
# ---------- mstb: Python ----------
"""Generate a Brick element from a list of mesh .
    the faces of the mesh '0' will be connected with the faces of the meshes '1' generating a brick element ( cube ).
    Attention : Each mesh in the list must have the same number of faces.
    Inputs:
        MeshSeries: quadMesh list with the same number of subdivisions .
    Output:
        Brick: Brick element --> Mesh with 6 faces and 8 nodes.
       """




ghenv.Component.Name = "Mesh Series to Brick (Alpaca4d)"
ghenv.Component.NickName = 'MSTB'
ghenv.Component.Message = "Mesh Series to Brick (Alpaca4d)"


import Rhino.Geometry as rg
import Grasshopper as gh

def MeshToShell(Mesh):
    
    Mesh.Unweld(0, True)
    mesh = Mesh.ExplodeAtUnweldedEdges()
    #print( len(mesh) )
    newMesh = []
    elementType = []
    for explodedMesh in mesh:
        newMesh.append(explodedMesh)
    return newMesh 

def brick( MeshList ):
    meshExpl = []
    Vertix = []
    elementType = []
    solid = []
    a = rg.Mesh.DuplicateMesh( MeshList[0] ) #.Unweld(0, True)
    a.Unweld(0, True)
    b = a.ExplodeAtUnweldedEdges()
    if len( b ) > 0 :
        for Mesh in MeshList:
            shellWrapper = MeshToShell(Mesh)
            meshExpl.append( shellWrapper )
        for index1 in range(0, len(MeshList)-1):
            for index2 in range(0, len(meshExpl[0])):
                if meshExpl[ index1 ][ index2 ].Vertices.Count == 4:
                    
                    elementType.append("stdBrick")
                    vertix1 = meshExpl[ index1 ][ index2 ].Vertices[0]
                    vertix2 = meshExpl[ index1 ][ index2 ].Vertices[1]
                    vertix3 = meshExpl[ index1 ][ index2 ].Vertices[2]
                    vertix4 = meshExpl[ index1 ][ index2 ].Vertices[3]
                    vertix5 = meshExpl[index1 + 1 ][ index2].Vertices[0]
                    vertix6 = meshExpl[index1 + 1 ][ index2].Vertices[1]
                    vertix7 = meshExpl[index1 + 1 ][ index2].Vertices[2]
                    vertix8 = meshExpl[index1 + 1 ][ index2].Vertices[3]
                    
                    vertix = [ vertix1, vertix2, vertix3, vertix4,
                    vertix5, vertix6, vertix7, vertix8 ]
                    
                    ele = rg.Mesh()
                    
                    ele.Vertices.Add( vertix1 ) # 0 
                    ele.Vertices.Add( vertix2 ) # 1
                    ele.Vertices.Add( vertix3 ) # 2
                    ele.Vertices.Add( vertix4 ) # 3
                    ele.Vertices.Add( vertix5 ) # 4
                    ele.Vertices.Add( vertix6 ) # 5
                    ele.Vertices.Add( vertix7 ) # 6
                    ele.Vertices.Add( vertix8 ) # 7
                    
                    ele.Faces.AddFace(0, 1, 2, 3) # 0
                    ele.Faces.AddFace(4, 5, 6, 7) # 1
                    ele.Faces.AddFace(0, 1, 5, 4) # 2
                    ele.Faces.AddFace(3, 2, 6, 7) # 3
                    ele.Faces.AddFace(1, 5, 6, 2) # 4
                    ele.Faces.AddFace(0, 4, 7, 3) # 5
                solid.append(ele)
                #ele.IsClosed()
                    
    else:
        for index1 in range(0, len(MeshList)-1):
            elementType.append("stdBrick")
            vertix1 = MeshList[ index1 ].Vertices[0]
            vertix2 = MeshList[ index1 ].Vertices[1]
            vertix3 = MeshList[ index1 ].Vertices[2]
            vertix4 = MeshList[ index1 ].Vertices[3]
            vertix5 = MeshList[index1 + 1 ].Vertices[0]
            vertix6 = MeshList[index1 + 1 ].Vertices[1]
            vertix7 = MeshList[index1 + 1 ].Vertices[2]
            vertix8 = MeshList[index1 + 1 ].Vertices[3]
            
            vertix = [ vertix1, vertix2, vertix3, vertix4,
            vertix5, vertix6, vertix7, vertix8 ]
            
            ele = rg.Mesh()
            
            ele.Vertices.Add( vertix1 ) # 0 
            ele.Vertices.Add( vertix2 ) # 1
            ele.Vertices.Add( vertix3 ) # 2
            ele.Vertices.Add( vertix4 ) # 3
            ele.Vertices.Add( vertix5 ) # 4
            ele.Vertices.Add( vertix6 ) # 5
            ele.Vertices.Add( vertix7 ) # 6
            ele.Vertices.Add( vertix8 ) # 7
            
            ele.Faces.AddFace(0, 1, 2, 3) # 0
            ele.Faces.AddFace(4, 5, 6, 7) # 1
            ele.Faces.AddFace(0, 1, 5, 4) # 2
            ele.Faces.AddFace(3, 2, 6, 7) # 3
            ele.Faces.AddFace(1, 5, 6, 2) # 4
            ele.Faces.AddFace(0, 4, 7, 3) # 5
            
            solid.append(ele)

    return solid

checkData = True

if not MeshSeries or len(MeshSeries) == 1 :  #is not None:
    checkData = False
    msg = "input MeshSeries failed to collect data"
    ghenv.Component.AddRuntimeMessage( gh.Kernel.GH_RuntimeMessageLevel.Warning, msg )

Closed = False if Closed is None else Closed

if checkData:
    if Closed == True:
        MeshSeries.append(MeshSeries[0])
    Brick= brick( MeshSeries )
# ---------- end mstb ----------
counter = CounterAlpaca4d()  # -> Counter; inputs Run: Boolean, Reset: Boolean
# ---------- counter: Python ----------
"""Counter
    Inputs:
        Run:
        Reset:
        Interval: how fast it will update (milliseconds)
    Output:
        Counter:"""

__author__ = "Marco Pellegrino"
__contact__ = "pellegrino.marco@icloud.com"
__linkedIn__ = "https://www.linkedin.com/in/mp0110/"

ghenv.Component.Name = "Counter (Alpaca4d)"
ghenv.Component.NickName = 'Counter'
ghenv.Component.Message = "Counter (Alpaca4d)"


import Grasshopper as gh
import math


def updateComponent(interval):
    
    """ Updates this component, similar to using a grasshopper timer """
    
    # Define callback action
    def callBack(e):
        ghenv.Component.ExpireSolution(False)
        
    # Get grasshopper document
    ghDoc = ghenv.Component.OnPingDocument()
    
    # Schedule this component to expire
    ghDoc.ScheduleSolution(interval,gh.Kernel.GH_Document.GH_ScheduleDelegate(callBack)) # Note that the first input here is how often to update the component (in milliseconds)


Interval = 1 if Interval is None else Interval


# Instantiate/reset persisent starting counter variable
if "myCounter" not in globals() or Reset:
    myCounter = 0

# Update the variable and component
if Run and not Reset:
    myCounter +=1
    updateComponent(Interval)

# Output counter
Counter = myCounter
# ---------- end counter ----------
clr_4 = ColorsAlpaca4d(gradIndex=11)  # -> colors; inputs gradIndex: Int32; same code as clr
txtmdl = TextToModelAlpaca4d()  # -> out, nodes, lines, shells, bricks, supports, constraints
# ---------- txtmdl: Python ----------
"""
Parse an OpenSees file
-
    Args:
        Path:
    Returns:
        nodes:
        lines:
        shells:
        bricks:
        supports:
        constraints:
        loads:
"""

ghenv.Component.Name = "Text to Model (Alpaca4d)"
ghenv.Component.NickName = 'TXTMDL'
ghenv.Component.Message = "Text to Model (Alpaca4d)"



import os
import sys
import collections
import re

import Rhino.Geometry as rg
import Grasshopper as gh


checkData = True

if not path:
    checkData = False
    msg = "Input parameter path failed to collect data"
    ghenv.Component.AddRuntimeMessage(gh.Kernel.GH_RuntimeMessageLevel.Warning, msg)


if checkData:

    fileType = os.path.splitext(path)[1]
    
    with open(path) as f:
        f.readline()
        file = []
        for line in f:
            file.append(line)
    
    
    # list with the implementedObject
    monoDimensionalObject = ["truss","corotTruss", "elasticBeamColumn","ElasticTimoshenkoBeam","dispBeamColumn","forceBeamColumn","twoNodeLink"]
    biDimensionalObject = ["ShellMITC4","ASDShellQ4","quad","ShellDKGQ","ShellNLDKGQ"]
    triDimensionalObject = ["SSPbrick","stdBrick"]
    
    
    nodeDict = collections.OrderedDict()
    supports = []
    constraints = []
    stickElement = collections.OrderedDict()
    shellElement = collections.OrderedDict()
    brickElement = collections.OrderedDict()
    
    
    # iterate over the text file
    
    for line in file:
        if fileType == ".py":
            line = line.replace(" ", "")        # remove whitespace from the python script
            line = line.replace("'","")         # remove '' from the python script
            line = line.replace('"',"")         # remove "" from the python script
            split = re.split("[(,)]", line.strip())
        elif fileType == ".tcl":
            split = line.strip().split(sep = " ")
        
        #print(split)
        
        if re.search("node",split[0]):
            index = int(split[1])
            nodeDict[index] = rg.Point3d(float(split[2]), float(split[3]), float(split[4]))
    
    
    
        if re.search("fix",split[0]):
            index = int(split[1])
            supports.append(nodeDict[index])
        
        
        
        
        elif re.search("element",split[0]):
            #print(split)
            if split[1] in monoDimensionalObject:
                index = int(split[2])
                start = int(split[3]) 
                end = int(split[4])
                startPoint = nodeDict[start]
                endPoint = nodeDict[end]
                stickElement[index] = rg.LineCurve(startPoint, endPoint)
    
    
            elif split[1] in biDimensionalObject:
                index = int(split[2])
                nodeId = [int(x) for x in split[3:7]]
                flatMesh = rg.Mesh()
                for id in nodeId:
                    flatMesh.Vertices.Add(nodeDict[id])
                flatMesh.Faces.AddFace(0, 1, 2, 3)
                shellElement[index] = flatMesh
    
    
            elif split[1] == "ShellDKGT" or split[1] == "ShellNLDKGT":
                index = int(split[2])
                nodeId = [int(x) for x in split[3:6]]
                flatMesh = rg.Mesh()
                for id in nodeId:
                    flatMesh.Vertices.Add(nodeDict[id])
                flatMesh.Faces.AddFace(0, 1, 2)
                shellElement[index] = flatMesh
    
    
    
            elif split[1] in triDimensionalObject:
                index = int(split[2])
                nodeId = [int(x) for x in split[3:11]]
                solidMesh = rg.Mesh()
                for id in nodeId:
                    solidMesh.Vertices.Add(nodeDict[id])
                solidMesh.Faces.AddFace(0, 1, 2, 3)
                solidMesh.Faces.AddFace(4, 5, 6, 7)
                solidMesh.Faces.AddFace(1, 2, 6, 5)
                solidMesh.Faces.AddFace(4, 7, 3, 0)
                solidMesh.Faces.AddFace(0, 1, 5, 4)
                solidMesh.Faces.AddFace(2, 3, 7, 6)
                brickElement[index] = solidMesh
    
    
    indexes = []
    nodes = []
    lines = []
    shells = []
    bricks = []
    
    for index, point in nodeDict.items():
        nodes.append(point)
    
    for index, line in stickElement.items():
        lines.append(line)
    
    for index, shell in shellElement.items():
        shells.append(shell)
    
    for index, brick in brickElement.items():
        bricks.append(brick)
    
    
    
    
    
    """
    joinedMesh = rg.Mesh()
    joinedMesh.Append(shells)
    
    shells = joinedMesh
    """
# ---------- end txtmdl ----------
ml = MeshLoftAlpaca4d()  # -> Mesh; inputs Polylines: list of Curve, Closed: Boolean
# ---------- ml: Python ----------
"""
Create a Mesh Loft. The code has been borrowed from Chromodoris and translated in python.
-
    Args:
        Polylines:
        Closed:
    Returns:
        Mesh:
"""

import Rhino.Geometry as rg
import Grasshopper as gh


ghenv.Component.Name = "Mesh Loft (Alpaca4d)"
ghenv.Component.NickName = 'ML'
ghenv.Component.Message = "Mesh Loft (Alpaca4d)"


checkData = True

if not Polylines:
    checkData = False
    msg = "Input parameter Polylines failed to collect data"
    ghenv.Component.AddRuntimeMessage(gh.Kernel.GH_RuntimeMessageLevel.Warning, msg)


if checkData:
    
    isClosed = Polylines[0].IsClosed
    Mesh = rg.Mesh()
    
    number_points = Polylines[0].PointCount
    
    
    if Closed == True:
        Polylines.append(Polylines[0])
    
    if number_points > 0:
        array = []
        for i in range(number_points):
            Mesh.Vertices.Add(Polylines[0].Point(i))
            array.append(i)
        
        for j in range(1, len(Polylines)):
            array2 = []
            for k in range(number_points):
                
                Mesh.Vertices.Add(Polylines[j].Point(k))
                array2.append(Mesh.Vertices.Count-1)
            
            
            
            for l in range(1, number_points):
                if l == number_points:
                    if isClosed:
                        Mesh.Faces.AddFace(array[l - 1], array[0], array2[0], array2[l - 1])
                Mesh.Faces.AddFace(array[l - 1], array[l], array2[l], array2[l - 1])
            
            array = array2
# ---------- end ml ----------
dst_5 = DrawScreenText()  # inputs Data: list, Colors: list, Pos: Int32; same code as dst_2
