# Grasshopper definition Earthquake Visualisation.gh (Grasshopper 1.0.7)
# plug-ins: Human

y_value_time_series = Data()
lng = ListLength(List=y_value_time_series)
series = Series(Start=0, Step=1, Count=lng)
pt = ConstructPoint(XCoordinate=series, YCoordinate=y_value_time_series, ZCoordinate=0)
bbox = BoundingBox(Content=pt, Plane=PlaneXY(0, 0, 0), UnionBox=True)  # -> Box, Box_2
dim = Dimensions(Surface=bbox.Box)  # -> UDimension, VDimension
division = Division(A="1", B=dim.VDimension)
division_2 = Division(A="1", B=dim.UDimension)
scale_nu = ScaleNU(Geometry=pt, Plane=PlaneXY(0, 0, 0), ScaleX=division_2, ScaleY=division, ScaleZ=1)  # -> Geometry, Transform
scale_nu_2 = ScaleNU(
    Geometry=scale_nu.Geometry,
    Plane=PlaneXY(0, 0, 0),
    ScaleX=Slider(528, range=1..800),
    ScaleY=Slider(201, range=1..800),
    ScaleZ=1)  # -> Geometry, Transform
number_slider = Slider(0, range=0..2000)
pline = PolyLine(Vertices=scale_nu_2.Geometry, Closed=False)
item = ListItem(List=scale_nu_2.Geometry, Index=number_slider, Wrap=True)

# ----
# Position
number_slider_2 = Slider(700, range=0..700)
pt_2 = ConstructPoint(XCoordinate="50", YCoordinate=number_slider_2, ZCoordinate=0)

# ----
# Frame
bbox_2 = BoundingBox(Content=pline, Plane=PlaneXY(0, 0, 0), UnionBox=True)  # -> Box, Box_2
area = Area(Geometry=bbox_2.Box)  # -> Area, Centroid
scale = Scale(Geometry=bbox_2.Box, Center=area.Centroid, Factor="1.05")  # -> Geometry, Transform
debrep = DeconstructBrep(Brep=scale.Geometry)  # -> Faces, Edges, Vertices
crv = Curve(debrep.Edges)
crvtoscreen = RenderCurveToScreen(
    Curve=crv,
    Location=pt_2,
    ScaleFactor=1,
    Color=ColourSwatch(SwatchColor=RGB(0, 0, 0)),
    Thickness="2",
    Depth=0.95,
    Fixed=Toggle(True),
    m_scWithvp=False)

# ----
# Text
number_slider_3 = Slider(19, range=1..100)
multiplication = Multiplication(A=number_slider_3, B="1.5")
neg = Negative(Value=multiplication)
Y = UnitY(Factor=neg)
item_2 = ListItem(List=debrep.Vertices, Index=0, Wrap=True)
move = Move(Geometry=item_2, Motion=Y)  # -> Geometry, Transform
txt = Text(number_slider)
xy = XYPlane(Origin=move.Geometry)
concat = Concatenate(FragmentA="t = ", FragmentB=txt)
python = GhPythonScript(plane=xy, textHeight=number_slider_3, text=concat)  # -> a; inputs plane: Plane, textHeight: Int32
# ---------- python: Python ----------
import Rhino.Geometry as rg

font = "Inconsolata"
textStyle = 0
closeLoops = True
plane = rg.Plane.WorldXY if plane is None else plane
smallCapsScale = 10
tolerance = 0.01

a = rg.Curve.CreateTextOutlines(text, font, textHeight, textStyle, closeLoops, plane, smallCapsScale, tolerance)
# ---------- end python ----------
crvtoscreen_2 = RenderCurveToScreen(
    Curve=python,
    Location=pt_2,
    ScaleFactor=1,
    Color=ColourSwatch(SwatchColor=RGB(0, 0, 0)),
    Thickness=1,
    Depth=0.95,
    Fixed=Toggle(True),
    m_scWithvp=False)

# ----
# Point
panel = Panel("5")
pt_3 = Point(item)
pttoscreen = RenderPointToScreen(
    Point=pt_3,
    Location=pt_2,
    ScaleFactor=1,
    Color=ColourSwatch(SwatchColor=RGB(255, 0, 0)),
    Radius=panel,
    Depth=0.95,
    Fixed=True,
    m_scWithvp=False)

# ----
# Curve Path
toggle = BooleanToggle(True)
crv_2 = Curve(pline)
crvtoscreen_3 = RenderCurveToScreen(
    Curve=crv_2,
    Location=pt_2,
    ScaleFactor=1,
    Color=ColourSwatch(SwatchColor=RGB(0, 0, 0)),
    Thickness=1,
    Depth=0.95,
    Fixed=toggle,
    m_scWithvp=False)
