# Grasshopper definition gsa_lookup.gh (Grasshopper 1.0.7)

index_gsa_point = Integer([1, 2, 3, 4, 5, 6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])
face_index = Integer(Tree({0;0}: [1, 1, 1, 1, 1, 2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], {0;1}: [17, 20, 18, 15, 22, 27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], {0;2}: [15, 19, 17, 23, 20, 25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], {0;3}: [15, 19, 17, 23, 20, 25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]))
split = SplitList(List=face_index, Index="100")  # -> ListA, ListB
python = GhPythonScript(f=split.ListA, gsa_indices=index_gsa_point)  # -> out, a; inputs f: tree of Int32, gsa_indices: list of Int32
# ---------- python: Python ----------
__author__ = "will"
__version__ = "2020.01.10"

import rhinoscriptsyntax as rs
from Grasshopper import DataTree
from Grasshopper.Kernel.Data import GH_Path

lookup = {}

for i in range(len(gsa_indices)):
    lookup[gsa_indices[i]] = i

tree = DataTree[int]()

for p in f.Paths:
    l = []
    for i in f.Branch(p):
        l.append(lookup[i])
    tree.AddRange(l, p)

a = tree
# ---------- end python ----------
python_2 = GhPythonScript(f=split.ListA, gsa_indices=index_gsa_point)  # -> out, a; inputs f: list of Int32, gsa_indices: list of Int32
# ---------- python_2: Python ----------
__author__ = "will"
__version__ = "2020.01.10"

import rhinoscriptsyntax as rs

lookup = {}

for i in range(len(gsa_indices)):
    lookup[gsa_indices[i]] = i

r = []

for i in f:
    r.append(lookup[i])

a = r
# ---------- end python_2 ----------
python_3 = GhPythonScript(f=split.ListA, gsa_indices=index_gsa_point)  # -> out, a; inputs f: Int32, gsa_indices: list of Int32; disabled
# ---------- python_3: Python ----------
__author__ = "will"
__version__ = "2020.01.10"

import rhinoscriptsyntax as rs

lookup = {}

for i in range(len(gsa_indices)):
    lookup[gsa_indices[i]] = i

a = lookup[f]
# ---------- end python_3 ----------
panel = Panel(python.a)
