# Grasshopper definition py_display_error2.gh (Grasshopper 1.0.7)

line = Line(Line((-7.504517266, -6.611122354, 0), (8.219233196, 3.51401999, 0)))
python = GhPythonScript()  # -> a; inputs x: Line
# ---------- python: Python ----------
from ghpythonlib.componentbase import executingcomponent as component
import Grasshopper, GhPython
import System
import Rhino
import rhinoscriptsyntax as rs

class MyComponent(component):
    
    def RunScript(self, x):
        """Provides a scripting component.
            Inputs:
                x: The x script variable
                y: The y script variable
            Output:
                a: The a output variable"""
        
        __author__ = "will"
        __version__ = "2020.09.16"
        
        import rhinoscriptsyntax as rs
        
        print("hey")
        
        # uncomment to define self.line if SetLine() isn't called
        #self.line = []
        
        def SetLine(l):
            if l:
                self.line = [l]
        
        # comment this line to start throwing display pipeline errors
        SetLine(x)
        
        # uncomment to throw error in script
        #print(self.line)
        
        return True
    
    def DrawViewportWires(self,arg):
        colour = System.Drawing.Color.SteelBlue
        for l in self.line:
            arg.Display.DrawLine(l, colour, 4)
# ---------- end python ----------
panel = Panel(python)
