# Grasshopper definition py_display_error4.gh (Grasshopper 1.0.7)

line = Line(Line((-7.504517266, -6.611122354, 0), (8.219233196, 3.51401999, 0)))
python = GhPythonScript(x=line, y=Toggle(False))  # -> a; inputs x: Line, y: Boolean
# ---------- python: Python ----------
from ghpythonlib.componentbase import executingcomponent as component
import Grasshopper, GhPython
import System
import Rhino
import rhinoscriptsyntax as rs

class MyComponent(component):
    
    def RunScript(self, x, y):
        """Provides a scripting component.
            Inputs:
                x: The x script variable
                y: The y script variable
            Output:
                a: The a output variable"""
        
        __author__ = "will"
        __version__ = "2020.09.16"
        
        import rhinoscriptsyntax as rs
        import Grasshopper as gh
        
        # uncomment to define self.line if SetLine() isn't called
        #self.line = []
        
        def SetLine(l):
            if l:
                self.line = [l]
        
        # comment this line to start throwing display pipeline errors
        SetLine(x)
        
        # uncomment to throw error in script
        #print(self.line)
        
        def callBack(e):
            self.ExpireSolution(False)
        
        if y:
            self.counter += 1
            
            doc = self.OnPingDocument()
            doc.ScheduleSolution(500, gh.Kernel.GH_Document.GH_ScheduleDelegate(callBack))
        else:
            self.counter = 0
            self.AddRuntimeMessage(gh.Kernel.GH_RuntimeMessageLevel.Remark, "RESET")
        
        self.Message = str(self.counter)
        
        return self.counter
    
    def DrawViewportWires(self,arg):
        colour = System.Drawing.Color.SteelBlue
        for l in self.line:
            arg.Display.DrawLine(l, colour, 4)
# ---------- end python ----------
panel = Panel(python)
