# Grasshopper definition rtree_python.gh (Grasshopper 1.0.7)
# plug-ins: Kangaroo2 Components, karambaGH

panel = Panel("20")

number_slider = Slider(1000, range=0..1000)  # disabled
number_slider_2 = Slider(192, range=0..1000)  # disabled
number_slider_3 = Slider(10, range=0..10)  # disabled
pop2d = Populate2D(Region={Plane=PlaneXY(0, 0, 0), Size=Domain2(u=0..20, v=0..10)}, Count=number_slider, Seed=1)  # disabled
item = ListItem(List=pop2d, Index=number_slider_2, Wrap=True)  # disabled
python = GhPythonScript(pointList=pop2d, searchPoint=item, radius=number_slider_3)  # -> out, pts, ind; inputs pointList: list of Point3d, searchPoint: Point3d; disabled
# ---------- python: Python ----------
import Rhino.Geometry as rg

__author__ = "david.leon"
__version__ = "2020.03.19"


#build the tree
tree = rg.RTree()

#add the points to the tree
for i in range(len(pointList)):
    tree.Insert(pointList[i], i)

closestPoints = []
closestIndices = []

#event handler of type RTreeEventArgs
def SearchCallback(sender, e):
    closestPoints.Add(pointList[e.Id])
    closestIndices.Add(e.Id)

tree.Search(rg.Sphere(searchPoint, radius), SearchCallback)

pts = closestPoints
ind = closestIndices
# ---------- end python ----------
preview = CustomPreview(
    Geometry=python.pts,
    Material={diffuse=RGB(221, 160, 221), emission=RGB(66, 48, 66), shine=0.5, specular=RGB(255, 255, 255), transparency=0})  # disabled

random = Random(Range="0 to 50", Number="50000", Seed="1")
random_2 = Random(Range="0 to 50", Number="50000", Seed="5")
random_3 = Random(Range="0 to 50", Number="50000", Seed="6")
pt = ConstructPoint(XCoordinate=random, YCoordinate=random_2, ZCoordinate=random_3)
rdpoints = RemoveDuplicatePointsKaramba3D(Point=pt, LimitDistance="0.001")  # -> OutPoint, Info, Indexes
jitter = Jitter(List=pt, Jitter=1, Seed=2)  # -> Values, Indices
pt_2 = ConstructPoint(XCoordinate=0, YCoordinate=0, ZCoordinate="1000")
python_script = PythonScript(points=pt, tol="0.001")  # -> out, a; inputs points: list
# ---------- python_script: Python ----------
import rhinoscriptsyntax as rs
import scriptcontext
import copy

if not tol:
    tol = scriptcontext.doc.ModelAbsoluteTolerance

def removeDuplicates(points):
    # Create a dictionary to keep track of the Id
    pointDict = {}
    ptList = []
    for pt in points:
        pt3d = rs.coerce3dpoint(pt)
        pointDict[pt3d] = pt
        ptList.append(pt3d)
    
    #sortList
    ptList.sort()
    ptLast = ptList[-1]
    
    for i in range(len(ptList)-2,-1,-1):
        if (abs(ptList[i][0]-ptLast[0]) < tol) and (abs(ptList[i][1]-ptLast[1])) < tol and (abs(ptList[i][2]-ptLast[2]) < tol):
            del ptList[i]
        else:
            ptLast = ptList[i]
    
    #find the the ids with the new list
    outputList = []
    for pt in ptList:
        ptId = pointDict[pt]
        outputList.append(ptId)
    
    return outputList

a = removeDuplicates(points)
# ---------- end python_script ----------
duppt = RemoveDuplicatePts(Points=pt, Tolerance="0.001")
number_slider_4 = Slider(0.01, range=0..0.01)
difference = SetDifference(SetA=rdpoints.OutPoint, SetB=python_script.a)

panel_2 = Panel("0")  # disabled
python_2 = GhPythonScript(pointList=pt, searchPoint=flatten([jitter.Values, pt_2]), radius=panel_2)  # -> out, pts, ind; inputs pointList: list of Point3d, searchPoint: list of Point3d; disabled
# ---------- python_2: Python ----------
import Rhino.Geometry as rg

__author__ = "david.leon"
__version__ = "2020.03.19"


#build the tree
tree = rg.RTree()

#add the points to the tree
for i in range(len(pointList)):
    tree.Insert(pointList[i], i)

#closestPoints = []
closestIndices = []

#event handler of type RTreeEventArgs
def SearchCallback(sender, e):
    #closestPoints.Add(pointList[e.Id])
    closestIndices.Add(e.Id)

for item in searchPoint:
    tree.Search(rg.Sphere(item, radius), SearchCallback)
    ind = closestIndices
    print(ind)
# ---------- end python_2 ----------

lng = ListLength()
lng_2 = ListLength(List=python_script.a)
panel_3 = Panel(difference)
panel_4 = Panel(lng_2)
panel_5 = Panel(python_2.ind)
