# Grasshopper definition testRtreeInComponent.gh (Grasshopper 1.0.7)
# plug-ins: MeshEdit Components, Pufferfish, Human, Kangaroo Components, Weaverbird, Kangaroo2 Components

# Format Engineers CAD Information Issue Disclaimer
# 
# Project: PROJECT NAME
# 
# You should use this model for reference purposes only to assist in co-ordinating your work and is supplementary to formally issued drawings. Once the data is introduced into your own CAD or other system Format Engineers Ltd. can take no responsibility for its accuracy.
# 
# The last set of formally issued paper drawings are the contractual documents which represent the current stage of design development. If you have any queries, please contact the project CAD co-ordinator or the CAD Development Team.
# 
# Changes:
# 
# YYYY-MM-DD: Summary of changes
# 
# Usage notes:
# 
# This definition includes a basic implementation of Merbarki's Farthest Point Seeding algorithm (2005), adapted for tracing lines of principal curvature on NURBS surfaces. Requires modified Triangle.NET, if this isn't attached then... good luck! There are currently two main limitations: (a) this implementation measures density in parameter space, and (b) it doesn't include the dynamic refinement of density that Mebarki suggests.
mesh = Mesh([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])
crv = Curve([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])
mesh_2 = Mesh(mesh)

# ----
# Concrete Shell
mesh_3 = Mesh(mesh_2)
refine = Refine(Mesh=mesh_3, Level=1)
mjoin = MeshJoin(Meshes=flatten(refine))
explode = MeshExplode(Mesh=mjoin, Interpolate=False)
mjoin_2 = MeshJoin(Meshes=flatten(explode))

weldvertices = MeshWeldVertices(Mesh=mjoin_2, Tolerance=0.01)  # -> RuntimeMessage, Mesh
mesh_4 = Mesh(weldvertices.Mesh)

# ----
# nDMaterial
# ElasticIsotropic
eim = ElasticIsotropicMaterialAlpaca4d(E="210", v="0.3", rho="7850")  # -> out, nDMaterial
# ---------- eim: Python ----------
"""
Create a nD Elastic Isotropic Material
-
    Args:
        name:
        E:
        G:
        v:
        rho:
    Returns:
        nDMaterial:
"""

ghenv.Component.Name = "Elastic Isotropic Material (Alpaca4d)"
ghenv.Component.NickName = 'EIM'
ghenv.Component.Message = "Elastic Isotropic Material\n (Alpaca4d)"


import sys
import Rhino.Geometry as rg
import Grasshopper as gh
import copy


## add alpaca install directory to system path

ghcompfolder = gh.Folders.DefaultAssemblyFolder
if ghcompfolder not in sys.path:
    sys.path.append(ghcompfolder)

try:
    from Alpaca4d import alpaca4d as alpaca
except:
    msg = "Cannot import Alpaca4d. Is the Alpaca4d folder available in " + ghcompfolder + "?"
    ghenv.Component.AddRuntimeMessage(gh.Kernel.GH_RuntimeMessageLevel.Error, msg)


checkData = True

if not E:
    checkData = False
    msg = "Input parameter E failed to collect data"
    ghenv.Component.AddRuntimeMessage(gh.Kernel.GH_RuntimeMessageLevel.Warning, msg)

if not G and not v:
    checkData = False
    msg = "Input parameter G or v failed to collect data"
    ghenv.Component.AddRuntimeMessage(gh.Kernel.GH_RuntimeMessageLevel.Warning, msg)

if not rho:
    checkData = False
    msg = "Input parameter rho failed to collect data"
    ghenv.Component.AddRuntimeMessage(gh.Kernel.GH_RuntimeMessageLevel.Warning, msg)

if checkData:
    nDMaterial = alpaca.ElasticIsotropic(name, E, G, rho, v)
# ---------- end eim ----------

mesh_5 = Mesh(mesh_2)  # disabled
bbox = BoundingBox(Content=mesh_5, Plane=PlaneXY(0, 0, 0), UnionBox=True)  # -> Box, Box_2; disabled

wbnaked = WeaverbirdsNakedBoundary(MeshClosedPolylines=mesh_4)  # disabled
pt = Point([Point(4.728302002, 3.870160103, 0), Point(3.638717651, 4.515593052, 0), Point(8.235173225, 9.790262222, 2.400000095), Point(7.145588875, 10.43569565, 2.400000095)])

# ----
# Plate Fiber Section
pfs = PlateFiberSectionAlpaca4d(thickness="0.15", nDMaterial=eim.nDMaterial)  # -> out, fiberSection
# ---------- pfs: Python ----------
"""
Create a Plate Fiber Section
-
    Args:
        secName:
        thickness:
        nDMaterial:
    Returns:
        fiberSection:
"""


import sys
import Rhino.Geometry as rg
import Grasshopper as gh
import copy

ghenv.Component.Name = "Plate Fiber Section (Alpaca4d)"
ghenv.Component.NickName = 'PFS'
ghenv.Component.Message = "Plate Fiber Section\n (Alpaca4d)"


## add alpaca install directory to system path

ghcompfolder = gh.Folders.DefaultAssemblyFolder
if ghcompfolder not in sys.path:
    sys.path.append(ghcompfolder)

try:
    from Alpaca4d import alpaca4d as alpaca
except:
    msg = "Cannot import Alpaca4d. Is the Alpaca4d folder available in " + ghcompfolder + "?"
    ghenv.Component.AddRuntimeMessage(gh.Kernel.GH_RuntimeMessageLevel.Error, msg)


checkData = True

if not thickness:
    checkData = False
    msg = "Input parameter thickness failed to collect data"
    ghenv.Component.AddRuntimeMessage(gh.Kernel.GH_RuntimeMessageLevel.Warning, msg)

if not nDMaterial:
    checkData = False
    msg = "Input parameter nDMaterial failed to collect data"
    ghenv.Component.AddRuntimeMessage(gh.Kernel.GH_RuntimeMessageLevel.Warning, msg)

if checkData:
    fiberSection = alpaca.PlateFiberSection(secName, thickness, nDMaterial)
# ---------- end pfs ----------

sort = SortList(Keys=wbnaked, ValuesA=wbnaked)  # -> Keys, ValuesA; disabled

panel = Panel("0.15")  # disabled
offmsh = OffsetMesh(Mesh=mesh_5, Distance=panel, BothSides=False, CreateSolid=True)  # disabled
medges = MeshEdges(Mesh=offmsh)  # -> NakedEdges, InteriorEdges, NonManifoldEdges; disabled
swatch = ColourSwatch(SwatchColor=RGB(0, 0, 0))  # disabled
swatch_2 = ColourSwatch(SwatchColor=RGB(255, 255, 255))  # disabled
crv_2 = Curve(medges.NakedEdges)  # disabled
swatch_3 = ColourSwatch(SwatchColor=RGB(0, 0, 0))  # disabled
crv_3 = Curve(medges.InteriorEdges)  # disabled
panel_2 = Panel("3")  # disabled
panel_3 = Panel("1")  # disabled
previewlw = CustomPreviewLineweights(Geometry=crv_2, Shader=swatch, Thickness=panel_2, Absolute=False)  # disabled
previewlw_2 = CustomPreviewLineweights(Geometry=crv_3, Shader=swatch_3, Thickness=panel_3, Absolute=False)  # disabled
preview = CustomPreview(Geometry=offmsh, Material=swatch_2)  # disabled

item = ListItem(List=sort.ValuesA, Index=0, Wrap=True)  # disabled

wbnaked_2 = WeaverbirdsNakedBoundary(MeshClosedPolylines=mesh_5)  # disabled
debrep = DeconstructBrep(Brep=bbox.Box)  # -> Faces, Edges, Vertices; disabled
splitatcorners = SplitAtCorners(Poly=wbnaked_2, Angle=1)  # -> Corners, Parts; disabled
curvepoint = PointOnCurve(splitatcorners.Parts, parameter=0.5)  # disabled
demesh = DeconstructMesh(Mesh=mesh_5)  # -> Vertices, Faces, Colours, Normals; disabled
crv_4 = Curve(debrep.Edges)  # disabled
offset = OffsetCurve(Curve=crv_4, Distance=1, Plane=PlaneXY(0, 0, 0), Corners=1)  # disabled
pdecon = Deconstruct(Point=demesh.Vertices)  # -> XComponent, YComponent, ZComponent; disabled
pdecon_2 = Deconstruct(Point=curvepoint)  # -> XComponent, YComponent, ZComponent; disabled
panel_4 = Panel("0.1")  # disabled
sort_2 = SortList(Keys=pdecon.ZComponent, ValuesA=demesh.Vertices)  # -> Keys, ValuesA; disabled
larger = LargerThan(FirstNumber=pdecon_2.ZComponent, SecondNumber=panel_4)  # -> LargerThan, OrEqualTo; disabled
item_2 = ListItem(List=reverse(sort_2.Keys), Index=0, Wrap=True)  # disabled
item_3 = ListItem(List=reverse(sort_2.ValuesA), Index=0, Wrap=True)  # disabled
cull = CullPattern(List=splitatcorners.Parts, CullPattern=larger.LargerThan)  # -> flatten(List); disabled
pt_2 = Point()  # disabled
join = JoinCurves(Curves=cull, Preserve=False)  # disabled
number_slider = Slider(0.2, range=0.01..0.5)  # disabled
x_tremez = Extremes(Curve=join, Plane=PlaneXY(0, 0, 0))  # -> Highest, Lowest; disabled
panel_5 = Panel("0.30")  # disabled
pt_3 = Point(x_tremez.Highest)  # disabled
line = LineSDL(Start=item_3, Direction=Vector(0, 0, 1), Length=panel_5)  # disabled
project = Project(Geometry=pt_3, Plane=PlaneXY(0, 0, 0))  # -> Geometry, Transform; disabled
ln = Line(StartPoint=pt_3, EndPoint=project.Geometry)  # disabled
number_slider_2 = Slider(0.2, range=0.01..0.5)  # disabled
markdim = MarkerDimension(Line=line, Text="Z={2:0.0}", Size=number_slider)  # disabled
linedim = LineDimension(Line=ln, Text="{0:0.00}", Size=number_slider_2)  # disabled
linedim_2 = LineDimension(Line=offset, Text="{0:0.00}", Size=number_slider)  # disabled

# ----
# Support
toggle = BooleanToggle(False)
toggle_2 = BooleanToggle(True)
python = GhPythonScript(Pos=pt, Tx=toggle_2, Ty=toggle_2, Tz=toggle_2, Rx=toggle, Ry=toggle, Rz=toggle)  # -> Support; inputs Pos: Point3d, Tx: Boolean, Ty: Boolean, Tz: Boolean, Rx: Boolean, Ry: Boolean, Rz: Boolean
# ---------- python: Python ----------
"""
Create a support
-
    Args:
        Pos:
        Tx:
        Ty:
        Tz:
        Rx:
        Ry:
    Returns:
        Support:
"""



from ghpythonlib.componentbase import executingcomponent as component
import Grasshopper, GhPython
import System
import Rhino
import rhinoscriptsyntax as rs

class MyComponent(component):
    
    def RunScript(self, Pos, Tx, Ty, Tz, Rx, Ry, Rz):
        
        
        import sys
        import Rhino.Geometry as rg
        import Grasshopper as gh
        
        
        ## add alpaca install directory to system path
        
        ghcompfolder = gh.Folders.DefaultAssemblyFolder
        if ghcompfolder not in sys.path:
            sys.path.append(ghcompfolder)
        
        try:
            from Alpaca4d import alpaca4d as alpaca
        except:
            msg = "Cannot import Alpaca4d. Is the Alpaca4d folder available in " + ghcompfolder + "?"
            ghenv.Component.AddRuntimeMessage(gh.Kernel.GH_RuntimeMessageLevel.Error, msg)
        
        checkData = True
        
        Tx = int(False) if Tx is None else int(Tx)
        Ty = int(False) if Ty is None else int(Ty)
        Tz = int(False) if Tz is None else int(Tz)
        Rx = int(False) if Rx is None else int(Rx)
        Ry = int(False) if Ry is None else int(Ry)
        Rz = int(False) if Rz is None else int(Rz)
        
        
        if not Pos:
            checkData = False
            msg = "Input parameter Pos failed to collect data"
            ghenv.Component.AddRuntimeMessage(gh.Kernel.GH_RuntimeMessageLevel.Warning, msg)
        
        if checkData:
            Support = alpaca.Support(Pos, Tx, Ty, Tz, Rx, Ry, Rz)
            return Support
# ---------- end python ----------

explode_2 = Explode(Curve=item, Recursive=True)  # -> Segments, Vertices; disabled

# ----
# Mesh to Shell
# ShellMITC4, ShellNLDKGT
swatch_4 = ColourSwatch(SwatchColor=RGB(53, 212, 38))
python_2 = GhPythonScript(Mesh=mesh_2, CrossSection=pfs.fiberSection, Colour=swatch_4)  # -> out, Shell; inputs Mesh: Mesh, Colour: Color
# ---------- python_2: Python ----------
"""
Create a support
-
    Args:
        Mesh:
        CrossSection:
        Colour:
    Returns:
        Shell:
"""


import sys
import Rhino.Geometry as rg
import Grasshopper as gh
import copy
from System.Drawing import Color


## add alpaca install directory to system path

ghcompfolder = gh.Folders.DefaultAssemblyFolder
if ghcompfolder not in sys.path:
    sys.path.append(ghcompfolder)

try:
    from Alpaca4d import alpaca4d as alpaca
except:
    msg = "Cannot import Alpaca4d. Is the Alpaca4d folder available in " + ghcompfolder + "?"
    ghenv.Component.AddRuntimeMessage(gh.Kernel.GH_RuntimeMessageLevel.Error, msg)


checkData = True

if not Mesh:
    checkData = False
    msg = "Input parameter Mesh failed to collect data"
    ghenv.Component.AddRuntimeMessage(gh.Kernel.GH_RuntimeMessageLevel.Warning, msg)

if not CrossSection:
    checkData = False
    msg = "Input parameter CrossSection failed to collect data"
    ghenv.Component.AddRuntimeMessage(gh.Kernel.GH_RuntimeMessageLevel.Warning, msg)

if not Colour:
    Colour = Color.Blue


if checkData:
    
    Mesh.Unweld(0,True)
    explodedMesh = Mesh.ExplodeAtUnweldedEdges()
    if explodedMesh.Length > 0:
        Shell = []
        for mesh in explodedMesh:
            if mesh.Vertices.Count == 4:
                Shell.append(alpaca.ShellMITC4(mesh, copy.deepcopy(CrossSection), Colour))
            elif mesh.Vertices.Count == 3:
                Shell.append(alpaca.ShellNLDKGT(mesh, copy.deepcopy(CrossSection), Colour))
    elif explodedMesh.Length == 0:
        if Mesh.Vertices.Count == 4:
                Shell = alpaca.ShellMITC4(Mesh, copy.deepcopy(CrossSection), Colour)
        elif Mesh.Vertices.Count == 3:
            Shell = alpaca.ShellNLDKGT(Mesh, copy.deepcopy(CrossSection), Colour)
    
    #Vertices = Shell.Mesh.Vertices.ToPoint3dArray()
# ---------- end python_2 ----------

# ----
# Constant Time Series
# Linear Time Series
cts = ConstantTimeSeriesAlpaca4d()  # -> timeSeries, Graph
# ---------- cts: Python ----------
"""
Create a Constant Time Series
-
    Args:
        tStart:
        tEnd:
        period:
        factor:
        shift:
    Returns:
        timeSeries:
        Graph:
"""

ghenv.Component.Name = "Constant Time Series (Alpaca4d)"
ghenv.Component.NickName = 'CTS'
ghenv.Component.Message = "Constant Time Series\n (Alpaca4d)"


import sys
import Rhino.Geometry as rg
import Grasshopper as gh
import copy
import math


## add alpaca install directory to system path

ghcompfolder = gh.Folders.DefaultAssemblyFolder
if ghcompfolder not in sys.path:
    sys.path.append(ghcompfolder)

try:
    from Alpaca4d import alpaca4d as alpaca
except:
    msg = "Cannot import Alpaca4d. Is the Alpaca4d folder available in " + ghcompfolder + "?"
    ghenv.Component.AddRuntimeMessage(gh.Kernel.GH_RuntimeMessageLevel.Error, msg)

def ConstantSeries(x):
    return x



checkData = True

if not constantFactor:
    constantFactor = 1


if checkData:
    timeSeries = alpaca.TimeSeriesConstant(constantFactor)
    
    Graph = []
    
    for x in range(10):
        Graph.append(ConstantSeries(constantFactor))
# ---------- end cts ----------
lts = LinearTimeSeriesAlpaca4d(linearFactor="1")  # -> timeSeries, Graph
# ---------- lts: Python ----------
"""
Create a Linear Time Series
-
    Args:
        tStart:
        tEnd:
        period:
        factor:
        shift:
    Returns:
        timeSeries:
        Graph:
"""

ghenv.Component.Name = "Linear Time Series (Alpaca4d)"
ghenv.Component.NickName = 'LTS'
ghenv.Component.Message = "Linear Time Series\n (Alpaca4d)"

import sys
import Rhino.Geometry as rg
import Grasshopper as gh
import copy
import math


## add alpaca install directory to system path

ghcompfolder = gh.Folders.DefaultAssemblyFolder
if ghcompfolder not in sys.path:
    sys.path.append(ghcompfolder)

try:
    from Alpaca4d import alpaca4d as alpaca
except:
    msg = "Cannot import Alpaca4d. Is the Alpaca4d folder available in " + ghcompfolder + "?"
    ghenv.Component.AddRuntimeMessage(gh.Kernel.GH_RuntimeMessageLevel.Error, msg)


def linearSeries(x):
    return x



checkData = True

if not linearFactor:
    linearFactor = 1




if checkData:
    timeSeries = alpaca.TimeSeriesLinear(linearFactor)
    
    Graph = []
    
    for x in range(10):
        Graph.append(linearSeries(x * linearFactor))
# ---------- end lts ----------

duppt = RemoveDuplicatePts(Points=explode_2.Vertices, Tolerance=0.01)  # disabled
mitc4 = ShellMITC4Alpaca4d(Mesh=mesh_2, CrossSection=pfs.fiberSection)  # -> out, flatten(Shell); inputs Mesh: Mesh, Colour: Color
# ---------- mitc4: Python ----------
"""
Create a ShellMITC4 element
-
    Args:
        Mesh:
        CrossSection:
        Colour:
    Returns:
        Shell:
"""

ghenv.Component.Name = "Shell MITC4 (Alpaca4d)"
ghenv.Component.NickName = 'MITC4'
ghenv.Component.Message = "ShellMITC4\n (Alpaca4d)"



import sys
import Rhino.Geometry as rg
import Grasshopper as gh
import copy
from System.Drawing import Color


## add alpaca install directory to system path

ghcompfolder = gh.Folders.DefaultAssemblyFolder
if ghcompfolder not in sys.path:
    sys.path.append(ghcompfolder)

try:
    from Alpaca4d import alpaca4d as alpaca
except:
    msg = "Cannot import Alpaca4d. Is the Alpaca4d folder available in " + ghcompfolder + "?"
    ghenv.Component.AddRuntimeMessage(gh.Kernel.GH_RuntimeMessageLevel.Error, msg)


checkData = True

if not Mesh:
    checkData = False
    msg = "Input parameter Mesh failed to collect data"
    ghenv.Component.AddRuntimeMessage(gh.Kernel.GH_RuntimeMessageLevel.Warning, msg)

if not CrossSection:
    checkData = False
    msg = "Input parameter CrossSection failed to collect data"
    ghenv.Component.AddRuntimeMessage(gh.Kernel.GH_RuntimeMessageLevel.Warning, msg)

if not Colour:
    Colour = Color.Blue


if checkData:
    
    Mesh.Unweld(0,True)
    explodedMesh = Mesh.ExplodeAtUnweldedEdges()
    if explodedMesh.Length > 0:
        Shell = []
        for mesh in explodedMesh:
            if mesh.Vertices.Count == 4:
                Shell.append(alpaca.ShellMITC4(mesh, copy.deepcopy(CrossSection), Colour))
            elif mesh.Vertices.Count == 3:
                Shell.append(alpaca.ShellNLDKGT(mesh, copy.deepcopy(CrossSection), Colour))
    elif explodedMesh.Length == 0:
        if Mesh.Vertices.Count == 4:
                Shell = alpaca.ShellMITC4(Mesh, copy.deepcopy(CrossSection), Colour)
        elif Mesh.Vertices.Count == 3:
            Shell = alpaca.ShellNLDKGT(Mesh, copy.deepcopy(CrossSection), Colour)
    
    #Vertices = Shell.Mesh.Vertices.ToPoint3dArray()
# ---------- end mitc4 ----------
avr = Average(Input=duppt)  # disabled

# ----
# Rigid Diaphgram
python_3 = GhPythonScript(masterNode=avr, slaveNodes=duppt)  # -> out, RigidDiaphragm; inputs masterNode: Point3d, slaveNodes: list of Point3d; disabled
# ---------- python_3: Python ----------
"""
Create a support
-
    Args:
        masterNode:
        slaveNodes:
    Returns:
        RigidDiaphragm:
"""


import sys
import Rhino.Geometry as rg
import Grasshopper as gh
import copy
from System.Drawing import Color


## add alpaca install directory to system path

ghcompfolder = gh.Folders.DefaultAssemblyFolder
if ghcompfolder not in sys.path:
    sys.path.append(ghcompfolder)

try:
    from Alpaca4d import alpaca4d as alpaca
except:
    msg = "Cannot import Alpaca4d. Is the Alpaca4d folder available in " + ghcompfolder + "?"
    ghenv.Component.AddRuntimeMessage(gh.Kernel.GH_RuntimeMessageLevel.Error, msg)


checkData = True

if not masterNode:
    checkData = False
    msg = "Input parameter masterNode failed to collect data"
    ghenv.Component.AddRuntimeMessage(gh.Kernel.GH_RuntimeMessageLevel.Warning, msg)

if not slaveNodes:
    checkData = False
    msg = "Input parameter slaveNodes failed to collect data"
    ghenv.Component.AddRuntimeMessage(gh.Kernel.GH_RuntimeMessageLevel.Warning, msg)


if checkData:
    RigidDiaphragm = alpaca.RigidDiaphragm(masterNode, slaveNodes)
# ---------- end python_3 ----------

uniaxial_elastic_material = UniaxialElasticMaterialAlpaca4d(E="210", v="0.3", rho="7850")  # -> out, uniAxialMaterial
# ---------- uniaxial_elastic_material: Python ----------
"""
Create a uniaxial Elastic Material
-
    Args:
        E:
        Eneg:
        eta:
        G:
        v:
        rho:
    Returns:
        uniAxialMaterial:
"""


import sys
import Rhino.Geometry as rg
import Grasshopper as gh
import copy


## add alpaca install directory to system path

ghcompfolder = gh.Folders.DefaultAssemblyFolder
if ghcompfolder not in sys.path:
    sys.path.append(ghcompfolder)

try:
    from Alpaca4d import alpaca4d as alpaca
except:
    msg = "Cannot import Alpaca4d. Is the Alpaca4d folder available in " + ghcompfolder + "?"
    ghenv.Component.AddRuntimeMessage(gh.Kernel.GH_RuntimeMessageLevel.Error, msg)


checkData = True

if not E:
    checkData = False
    msg = "Input parameter E failed to collect data"
    ghenv.Component.AddRuntimeMessage(gh.Kernel.GH_RuntimeMessageLevel.Warning, msg)

if not G and not v:
    checkData = False
    msg = "Input parameter G or v failed to collect data"
    ghenv.Component.AddRuntimeMessage(gh.Kernel.GH_RuntimeMessageLevel.Warning, msg)

if not rho:
    checkData = False
    msg = "Input parameter rho failed to collect data"
    ghenv.Component.AddRuntimeMessage(gh.Kernel.GH_RuntimeMessageLevel.Warning, msg)



if checkData:
    uniAxialMaterial = alpaca.uniAxialMaterialElastic(name, E, Eneg, eta, G, v, rho)
# ---------- end uniaxial_elastic_material ----------
pt_4 = Point([Point(4.325274486, 4.3366262, 0.1333333403), Point(4.507751006, 4.644672889, 0.2666666806), Point(4.675107369, 4.927194504, 0.400000006), Point(4.831871638, 5.191834963, 0.5333333611), Point(4.994991192, 5.467204241, 0.6666666865), Point(5.160229096, 5.746149687, 0.8000000119)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])
pt_5 = ConstructPoint(XCoordinate=0, YCoordinate=0, ZCoordinate=0)
circle_cross_section = CircleCrossSectionAlpaca4d(d="0.20", t="0.02", material=uniaxial_elastic_material.uniAxialMaterial)  # -> out, CrossSection
# ---------- circle_cross_section: Python ----------
"""
Create a Circle Cross Section
-
    Args:
        secName:
        Area:
        Izz:
        Iyy:
        J:
        alphaY:
        alphaZ:
        material:
    Returns:
        genericSection:
"""


import sys
import Rhino.Geometry as rg
import Grasshopper as gh
import copy


## add alpaca install directory to system path

ghcompfolder = gh.Folders.DefaultAssemblyFolder
if ghcompfolder not in sys.path:
    sys.path.append(ghcompfolder)

try:
    from Alpaca4d import alpaca4d as alpaca
except:
    msg = "Cannot import Alpaca4d. Is the Alpaca4d folder available in " + ghcompfolder + "?"
    ghenv.Component.AddRuntimeMessage(gh.Kernel.GH_RuntimeMessageLevel.Error, msg)


checkData = True

if not d:
    checkData = False
    msg = "Input parameter d failed to collect data"
    ghenv.Component.AddRuntimeMessage(gh.Kernel.GH_RuntimeMessageLevel.Warning, msg)

if not t:
    checkData = False
    msg = "Input parameter t failed to collect data"
    ghenv.Component.AddRuntimeMessage(gh.Kernel.GH_RuntimeMessageLevel.Warning, msg)

if not material:
    checkData = False
    msg = "Input parameter material failed to collect data"
    ghenv.Component.AddRuntimeMessage(gh.Kernel.GH_RuntimeMessageLevel.Warning, msg)



if checkData:
    circleCS = alpaca.CircleCS(d,t,material)
    CrossSection = alpaca.ElasticSection(secName, circleCS.Area(), circleCS.Izz(), circleCS.Iyy(), circleCS.J(), circleCS.alphaY, circleCS.alphaZ, circleCS.material)
    CrossSection.crv = circleCS.crv
# ---------- end circle_cross_section ----------

# ----
# PointLoad
panel_6 = Panel("-0.25")
vec = VectorXYZ(XComponent=0, YComponent=0, ZComponent=panel_6)  # -> Vector, Length
python_4 = GhPythonScript(Pos=pt_4, Force=vec.Vector, TimeSeries=lts.timeSeries)  # -> out, PointLoad; inputs Pos: Point3d, Force: Vector3d, Moment: Vector3d
# ---------- python_4: Python ----------
"""
Create a PointLoad
-
    Args:
        Pos:
        Force:
        Moment:
        TimeSeries:
    Returns:
        PointLoad:
"""

import sys
import Rhino.Geometry as rg
import Grasshopper as gh
import copy


## add alpaca install directory to system path

ghcompfolder = gh.Folders.DefaultAssemblyFolder
if ghcompfolder not in sys.path:
    sys.path.append(ghcompfolder)

try:
    from Alpaca4d import alpaca4d as alpaca
except:
    msg = "Cannot import Alpaca4d. Is the Alpaca4d folder available in " + ghcompfolder + "?"
    ghenv.Component.AddRuntimeMessage(gh.Kernel.GH_RuntimeMessageLevel.Error, msg)


checkData = True

if not Pos:
    checkData = False
    msg = "Input parameter Pos failed to collect data"
    ghenv.Component.AddRuntimeMessage(gh.Kernel.GH_RuntimeMessageLevel.Warning, msg)

if not Force:
    Force = rg.Vector3d(0,0,0)

if not Moment:
    Moment = rg.Vector3d(0,0,0)

if not TimeSeries:
    checkData = False
    msg = "Input parameter TimeSeries failed to collect data"
    ghenv.Component.AddRuntimeMessage(gh.Kernel.GH_RuntimeMessageLevel.Warning, msg)


if checkData:
    PointLoad = alpaca.PointLoad(Pos, Force, Moment, TimeSeries)
# ---------- end python_4 ----------

line_2 = LineSDL(Start=pt_4, Direction=Vector(0, 0, 1), Length=1)
divide = DivideCurve(Curve=line_2, Count="4", Kinks=False)  # -> Points, Tangents, Parameters
pline = PolyLine(Vertices=divide.Points, Closed=False)
explode_3 = Explode(Curve=pline, Recursive=True)  # -> flatten(Segments), Vertices
end = EndPoints(Curve=pline)  # -> Start, End
X = UnitX(Factor=1)
fbc = ForceBeamColumnAlpaca4d(Line=explode_3.Segments, CrossSection=circle_cross_section.CrossSection)  # -> out, element; inputs Line: Curve, Colour: Color
# ---------- fbc: Python ----------
"""
Create a Force Beam Column
-
    Args:
        Line:
        CrossSection:
        Colour:
        Orient:
    Returns:
        element:
"""

ghenv.Component.Name = "Force Beam Column (Alpaca4d)"
ghenv.Component.NickName = 'FBC'
ghenv.Component.Message = "Force Beam Column (Alpaca4d)"


import sys
import Rhino.Geometry as rg
import Grasshopper as gh
import copy
from System.Drawing import Color

## add alpaca install directory to system path

ghcompfolder = gh.Folders.DefaultAssemblyFolder
if ghcompfolder not in sys.path:
    sys.path.append(ghcompfolder)

try:
    from Alpaca4d import alpaca4d as alpaca
except:
    msg = "Cannot import Alpaca4d. Is the Alpaca4d folder available in " + ghcompfolder + "?"
    ghenv.Component.AddRuntimeMessage(gh.Kernel.GH_RuntimeMessageLevel.Error, msg)


checkData = True

if not Line:
    checkData = False
    msg = "Input parameter Line failed to collect data"
    ghenv.Component.AddRuntimeMessage(gh.Kernel.GH_RuntimeMessageLevel.Warning, msg)


if not CrossSection:
    checkData = False
    msg = "Input parameter CrossSection failed to collect data"
    ghenv.Component.AddRuntimeMessage(gh.Kernel.GH_RuntimeMessageLevel.Warning, msg)

if not Colour:
    Colour = Color.Red

if not Orient:
    Orient = 0.0


if checkData:
    newCrossSection = copy.deepcopy(CrossSection)
    element = alpaca.ForceBeamColumn(Line, newCrossSection, Colour, Orient)
# ---------- end fbc ----------
pt_6 = Point(flatten(end.End))
python_5 = GhPythonScript(Pos=pt_6, Force=X, TimeSeries=lts.timeSeries)  # -> out, PointLoad; inputs Pos: Point3d, Force: Vector3d, Moment: Vector3d; same code as python_4

# ----
# tcl
python_6 = GhPythonScript(
    Element=flatten([mitc4.Shell, fbc.element]),
    Support=flatten(python),
    Load=flatten([python_4.PointLoad, python_5.PointLoad]))  # -> out, model, uniquePoint; inputs Element: list, Support: list, Load: list, Constraint: list
# ---------- python_6: Python ----------
import os
from Alpaca4d import alpaca4d as alpaca
import ghpythonlib.treehelpers as th
import Rhino.Geometry as rg
import rhinoscriptsyntax as rs
from collections import defaultdict, OrderedDict
import copy
import time



FolderPath = rs.DocumentPath()
os.chdir(FolderPath)

# create the object model
model = alpaca.Model()


start = time.clock()
#subdivide element per type

for element in Element:
    if element.type == "Beam":
        model.beams.append(element)
    elif element.type == "Shell":
        model.shells.append(element)
    elif element.type == "Brick":
        model.bricks.append(element)

end = time.clock() - start

print("time to subdivide element {}".format(end))

# create a list of unique point
# need to add the rigid constraint

model.getuniquePoints(model.beams, model.shells, model.bricks, model.constraints)


end = time.clock() - end

print("time to get uniquepoints {}".format(end))

#############
# create node and assign to object
#############

if model.uniquePointsThreeNDF:
    model.py.append(alpaca.Model.write3ndf_tcl())
    for point in model.uniquePointsThreeNDF:
        node = alpaca.Node(point)
        node.ndf = 3
        node.setNodeTag(model.cloudPoint)
        model.nodes.append( node )
    
        model.py.append(node.write_tcl())

if model.uniquePointsSixNDF:
    model.py.append(alpaca.Model.write6ndf_tcl())
    for point in model.uniquePointsSixNDF:
        node = alpaca.Node(point)
        node.ndf = 6
        node.setNodeTag(model.cloudPoint)
        model.nodes.append( node )
     
        model.py.append(node.write_tcl())



#a = model.sixNDFModel
#b = model.threeNDFModel

#################
# create supports
#################

for supportNode in Support:
    if model.uniquePointsThreeNDF.Contains(supportNode.Pos):
        supportNode.ndf = 3
        model.threeNDFModel.append(supportNode)
    elif model.uniquePointsSixNDF.Contains(supportNode.Pos):
        supportNode.ndf = 6
        model.sixNDFModel.append(supportNode)
    else:
        raise ValueError('I can not find the node at location {0}'.format(supportNode.Pos.ToString()))
    
    supportNode.setNodeTag(model.cloudPoint)
    model.supports.append(supportNode)
    model.py.append(supportNode.write_tcl())



####################
# create constraints
####################


for constraint in Constraint:
    constraint.setNodeTag(model.cloudPoint)
    model.constraints.append(constraint)


# write py file


# assign tag and node Index to element and shell
for index, element in enumerate(Element,1):
    element.setTopology(model.cloudPoint)
    element.eleTag = index
    # assign the same eleTag at the rest
    element.setTags()


## load

for item in Load:
    item.setNodeTag(model.cloudPoint)

for item in model.beams:
    model.py.append(item.write_tcl())

for item in model.shells:
    model.py.append(item.write_tcl())

for item in model.bricks:
    model.py.append(item.write_tcl())


for item in Constraint:
    model.py.append(item.write_tcl())


timeSeriesDict = alpaca.TimeSeries.getTimeSeries(Load)[1]

#model.py.append(alpaca.PointLoad.write_tcl(timeSeriesDict))
model.py.append(alpaca.PointLoad.write_tcl(timeSeriesDict,model))


print(type(timeSeriesDict[1][0].Pos))
# ---------- end python_6 ----------

python_7 = GhPythonScript()  # -> out, a
# ---------- python_7: Python ----------
import os
import System.Drawing.Color

import Rhino.Geometry as rg
import Rhino

import ghpythonlib.components as ghcomp

from collections import OrderedDict
from collections import defaultdict

import math
import subprocess


#TODO
# USE SELF.TYPEELEMENT TO WRITE THE OBJECT TYPE
# GEOMTRANSFORMATION NEEDS TO BE IS OWN OBJECT
# BEAM INTEGRATION OWN OBJECT

class Model(object):
    def __init__(self, ndm = 3, ndf = 6):
        
        self.ndm = ndm
        self.ndf = ndf

        self.uniquePoints = []
        self.uniquePointsThreeNDF = []
        self.uniquePointsSixNDF = []
        self.cloudPoint = None


        self.nodes = []
        self.elements = []
        self.supports = []
        self.constraints = []
        self.loads = []
        self.materials = []

        self.timeSeries = {}

        self.beams = []
        self.shells = []
        self.bricks = []

        self.recorder = []
        self.recorderName = None

        #self.pointLoad = defaultdict(list)
        self.pointLoad = []

        self.filename = None

        self.threeNDFModel = []
        self.sixNDFModel = []

        self.analysis = None

        self.py = []


    def getuniquePoints(self, beams, shells, bricks, constraints):
        """Cull Duplicates Points.

        Keyword arguments:
        beams -- List of beams
        shells -- List of shells

        return (List of uniquePoints, PointCloud)
        """

        threeNDFPoints = []
        sixNDFPoints = []

        AllPoints = []

        for beam in beams:
            # need to add an if for truss elements
            PointAtStart = beam.Crv.PointAtStart
            PointAtEnd = beam.Crv.PointAtEnd
            sixNDFPoints.append(PointAtStart)
            sixNDFPoints.append(PointAtEnd)

        for shell in shells:
            vertices = shell.Mesh.Vertices.ToPoint3dArray()
            for node in vertices:
                sixNDFPoints.append(node)
        
        for brick in bricks:
            vertices = brick.Mesh.Vertices.ToPoint3dArray()
            for node in vertices:
                threeNDFPoints.append(node)
        
        for constraint in constraints:
            sixNDFPoints.extend(constraint.slaveNodes, constraint.masterNode)
        
        if not threeNDFPoints:
            self.uniquePointsThreeNDF = []
        else:
            self.uniquePointsThreeNDF = rg.Point3d.CullDuplicates(threeNDFPoints, 0.001)
        
        if not sixNDFPoints:
            self.uniquePointsSixNDF = []
        else:
            self.uniquePointsSixNDF = rg.Point3d.CullDuplicates(sixNDFPoints, 0.001)
        
        
        #self.uniquePoints = self.uniquePointsThreeNDF + self.uniquePointsSixNDF
        if not self.uniquePointsThreeNDF:
            self.uniquePoints = self.uniquePointsSixNDF
        elif not self.uniquePointsSixNDF:
            self.uniquePoints = self.uniquePointsThreeNDF
        else:
            self.uniquePoints = self.uniquePointsThreeNDF + self.uniquePointsSixNDF
        
        self.cloudPoint = rg.PointCloud(self.uniquePoints)

        return


    ## override Rhino .ToString() method (display name of the class in Gh)
    def ToString(self):
        return "<Class Model>"

    #TODO
    @staticmethod
    def write3ndf_py():
        return "ops.model('basic', '-ndm', 3, '-ndf', 3)\n"

    @staticmethod
    def write6ndf_py():
        return "ops.model('basic', '-ndm', 3, '-ndf', 6)\n"
    
    #TODO
    @staticmethod
    def write3ndf_tcl():
        return "model BasicBuilder -ndm 3 -ndf 3\n"

    @staticmethod
    def write6ndf_tcl():
        return "model BasicBuilder -ndm 3 -ndf 6\n"

    def writeFile(self, filename):
        
        textFile = self.py
            
        with open(filename, 'w') as f:
            for line in textFile:
                f.write("%s\n" % line)
        self.filename = filename
        pass

    def runOpensees(self, args):

        if args == 'python':
            executable = 'python.exe'
        elif args == 'tcl':
            executable = 'opensees.exe'
        else:
            executable = args

        process = subprocess.Popen([executable, self.filename], shell = True, stdout=subprocess.PIPE, stderr=subprocess.PIPE)
        stdout, stderr = process.communicate()
        return stdout, stderr

class Node(object):
    def __init__(self, Pos):
        
        self.Pos = Pos
        self.nodeTag = None
        self.ndf = None

        self.mass = 0

        self.displacement = None
        self.rotation = None

    def setNodeTag(self, cloudPoint):
        self.nodeTag = cloudPoint.ClosestPoint(self.Pos) + 1
        pass

    def setMassNode(self, MassElement):
        self.mass = MassElement
        pass

    ## override Rhino .ToString() method (display name of the class in Gh)
    def ToString(self):
        return self.write_tcl()

    def write_tcl(self):
        if self.ndf == 6:
            tcl_text = "node {} {} {} {} -mass {} {} {} {} {} {}".format(self.nodeTag, float(self.Pos.X), float(self.Pos.Y), float(self.Pos.Z), self.mass, self.mass, self.mass, self.mass, self.mass, self.mass)
        elif self.ndf == 3:
            tcl_text = tcl_text = "node {} {} {} {} -mass {} {} {}".format(self.nodeTag, float(self.Pos.X), float(self.Pos.Y), float(self.Pos.Z), self.mass, self.mass, self.mass)
        else:
            raise ValueError('No ndf has been assigned')
        return tcl_text

    def write_py(self):
        if self.ndf == 6:
            py_text = "ops.node({}, {}, {}, {}, '-mass', {}, {}, {}, {}, {}, {})".format(self.nodeTag, float(self.Pos.X), float(self.Pos.Y), float(self.Pos.Z), self.mass, self.mass, self.mass, self.mass, self.mass, self.mass)
        elif self.ndf == 3:
            py_text = "ops.node({}, {}, {}, {}, '-mass', {}, {}, {})".format(self.nodeTag, float(self.Pos.X), float(self.Pos.Y), float(self.Pos.Z), self.mass, self.mass, self.mass)# ops.node(nodeTag, *crds, '-ndf', ndf, '-mass', *mass)
        else:
            raise ValueError('No ndf has been assigned')
        return py_text

#####################################################
### Material ########################################
#####################################################

class uniAxialMaterialElastic(object):
    def __init__(self, matName, E, Eneg, eta, G, v, rho):
        """Generate a uniaxial Elastic Material
            Inputs:
                matName: Name of the material.
                E: Young's Modulus [MPa].
                eta = damping tangent.
                G: Tangential Modulus [MPa].
                v: Poisson ratio.
                rho: specific weight [kN/m3].
                fy: Yield stress value of the material [MPa]"""


        self.matName = matName
        self.E = E
        self.Eneg = Eneg
        self.eta = eta
        self.G = G
        self.v = v
        self.rho = rho

        self.matTag = None

        if self.eta == None:
            self.eta = 0.0

        if self.Eneg == None:
            self.Eneg = E

        self.materialDimension = "uniAxialMaterial"
        self.materialType = "Elastic"

        if self.v == None:
            self.G = G  # Input value in N/mm2 ---> Output kN/m2
            self.v = (E / (2 * G)) - 1
        else:
            self.G = E / (2 * (1 + v))

    def ToString(self):
        return self.write_tcl()

    def write_tcl(self):
        return "uniaxialMaterial Elastic {} {} {} {}\n".format(self.matTag, self.E, self.eta, self.Eneg)

    def write_py(self):
        return "ops.uniaxialMaterial('Elastic', {}, {}, {}, {})\n".format(self.matTag, self.E, self.eta, self.Eneg)

class uniAxialMaterialElasticPlastic(object):
    def __init__(self, matName, E, epsyP, epsyN, eps0, rho):
        """Generate a uniaxial Elastic Material
            Inputs:
                matName: Name of the material.
                matTag: Material identifier number.
                E: Young's Modulus [MPa].
                epsyP: strain or deformation at which material reaches plastic state in tension.
                epsyN: strain or deformation at which material reaches plastic state in compression.
                eps0: initial strain.
                rho: specific weight [kN/m3]
                fy: Yield stress value of the material [MPa]"""


        self.matName = matName
        self.E = E
        self.epsyP = epsyP
        self.epsyN = epsyN
        self.eps0 = eps0
        self.v = v
        self.rho = rho
        
        self.matTag = None

        if self.epsyN == None:
            self.epsyN = epsyP

        self.materialDimension = "uniAxialMaterial"
        self.materialType = "ElasticPlastic"

    def ToString(self):
        return self.write_tcl()

    def write_tcl(self):
        return "uniaxialMateria ElasticPP {} {} {} {} {}\n".format(self.matTag, self.E, self.epsyP, self.epsyN, self.eps0)

    # TODO
    def write_py(self):
        return "ops.uniaxialMateria('ElasticPP',{},{},{},{},{})\n".format(self.matTag, self.E, self.epsyP, self.epsyN, self.eps0)
    

class ElasticIsotropic(object):
    def __init__(self, matName, E, G, rho=0.0, v=None):
        """Generate a n-Dimensional Elastic Isotropic Material
            Inputs:
                matName: Name of the material.
                E: Young's Modulus [MPa].
                G: Tangential Modulus [MPa].
                rho: specific weight [kN/m3].
                v: Poisson ratio.
                fy: Yield stress value of the material [MPa]"""

        self.matName = matName
        self.E = E
        self.G = G
        self.v = v
        self.rho = rho

        self.matTag = None

        self.materialDimension = "nDMaterial"
        self.materialType = "ElasticIsotropic"

        if self.v == None:
            self.v = (E / (2 * G)) - 1

    def ToString(self):
        return self.write_tcl()

    def write_tcl(self):
        tcl_text = "nDMaterial ElasticIsotropic {} {} {} {}\n".format(self.matTag, self.E, self.v, self.rho)
        return tcl_text

    def write_py(self):
        py_text = "ops.nDMaterial('ElasticIsotropic', {}, {}, {}, {})\n".format(self.matTag, self.E, self.v, self.rho)
        return py_text

class ElasticOrthotropic(object):
    def __init__(self, matName, Ex, Ey, Ez, vxy, vyz, vzx, Gxy, Gyz, Gzx, rho):

        self.matName = matName
        self.Ex = Ex
        self.Ey = Ey
        self.Ez = Ez
        self.vxy = vxy
        self.vyz = vyz
        self.vzx = vzx
        self.Gxy = Gxy
        self.Gyz = Gyz
        self.Gzx = Gzx
        self.rho = rho

        self.matTag = None

        self.materialDimension = "nDMaterial"
        self.materialType = "ElasticOrthotropic"

    def ToString(self):
        return "ElasticOrthotropic Material"

    def write_tcl(self):
        # nDMaterial ElasticOrthotropic $matTag $Ex $Ey $Ez $vxy $vyz $vzx $Gxy $Gyz $Gzx <$rho>
        tcl_text = "nDMaterial ElasticOrthotropic {} {} {} {} {} {} {} {} {} {} {}\n".format(self.matTag, self.Ex, self.Ey, self.Ez, self.vxy, self.vyz, self.vzx, self.Gxy, self.Gyz, self.Gzx, self.rho )
        return tcl_text

    def write_py(self):
        py_text = "ops.nDMaterial('ElasticOrthotropic', {}, {}, {}, {}, {}, {}, {}, {}, {}, {}, {})\n".format(self.matTag, self.Ex, self.Ey, self.Ez, self.vxy, self.vyz, self.vzx, self.Gxy, self.Gyz, self.Gzx, self.rho )
        return py_text

#TO REVIEW
class J2Plasticity(object):
    def __init__(self, K, G, sig0, sigInf, delta, H):
        """This command is used to construct an multi dimensional material object that has a von Mises (J2) yield criterium and isotropic hardening.
        matTag (int) 	integer tag identifying material
        K (float) 	    bulk modulus
        G (float) 	    shear modulus
        sig0 (float) 	initial yield stress
        sigInf (float) 	final saturation yield stress
        delta (float) 	exponential hardening parameter
        H (float) 	    linear hardening parameter"""

        self.K = K
        self.G = G
        self.sig0 = sig0
        self.sigInf = sigInf
        self.delta = delta
        self.H = H

        self.matTag = None

        self.materialDimension = "nDMaterial"
        self.materialType = "ElasticIsotropicHardening"

    def ToString(self):
        return write_tcl()

    def write_tcl(self):
        tcl_text = "nDMaterial J2Plasticity {0} {1} {2} {3} {4} {5} {6}\n".format(self.matTag, self.K, self.G, self.sig0, self.sigInf, self.delta, self.H)
        return tcl_text

    def write_py(self):
        py_text = "ops.nDMaterial('J2Plasticity', {0}, {1}, {2}, {3}, {4}, {5}, {6})\n".format(self.matTag, self.K, self.G, self.sig0, self.sigInf, self.delta, self.H)
        return py_text

#####################################################
### Element #########################################
#####################################################

#TODO update the integration text for tcl
class ForceBeamColumn(object):

    def __init__(self, Crv, CrossSection, Colour, OrientSection):

        self.Crv = Crv
        self.CrossSection = CrossSection
        self.Colour = Colour
        self.OrientSection = OrientSection

        self.type = "Beam"
        
        self.eleTag = None
        self.iNode = None
        self.jNode = None

        self.ndf = 6

        self.transfTag = None
        self.integrationTag = None

        self.elementType = "forceBeamColumn"

        self.massDens = self.CrossSection.Area * self.CrossSection.material.rho

    # each element will have a unique tag for Section, TransfTag, IntegrationTag, MaterialTag
    def setTags(self):

        self.transfTag = self.eleTag
        self.integrationTag = self.eleTag

        self.CrossSection.sectionTag = self.eleTag
        self.CrossSection.material.matTag = self.eleTag

        #self.transfTag = index
        #self.integrationTag = index

        #self.CrossSection.sectionTag = index
        #self.CrossSection.material.matTag = index
        pass


    def getPerpFrame(self):
        line = self.Crv
        midPoint =  line.PointAtNormalizedLength(0.5)
        parameter = line.ClosestPoint(midPoint, 0.01)[1]
        perpFrame = ghcomp.PerpFrame( line, parameter )
        return perpFrame

    def getGeomTransfVector(self):
        axis = self.getPerpFrame().YAxis
        return axis


    def setTopology(self, cloudPoint):
        # cloudPoint is a cloudPoint rhino type
        
        PointAtStart = self.Crv.PointAtStart
        PointAtEnd = self.Crv.PointAtEnd
        
        #CloudPoint = rg.PointCloud(uniquePoint)
        self.iNode = cloudPoint.ClosestPoint(PointAtStart) + 1
        self.jNode = cloudPoint.ClosestPoint(PointAtEnd) + 1
        pass

    def beamIntegrationNewtonCotes_py(self, numberOfSection):
        return "ops.beamIntegration('NewtonCotes', {}, {}, {})\n".format( self.integrationTag, self.CrossSection.sectionTag, numberOfSection)

    def beamIntegrationNewtonCotes_tcl(self, numberOfSection):
        return "NewtonCotes {} {}".format( self.CrossSection.sectionTag, numberOfSection)

    #write a text geomTransf
    def geomTransf_py(self):
        return "ops.geomTransf('Linear',{},{},{},{})\n".format(self.transfTag, self.getGeomTransfVector().X, self.getGeomTransfVector().Y, self.getGeomTransfVector().Z)
    
    def geomTransf_tcl(self):
        return "geomTransf Linear {} {} {} {}\n".format(self.transfTag, self.getGeomTransfVector().X, self.getGeomTransfVector().Y, self.getGeomTransfVector().Z)

    def ToString(self):
        return self.write_tcl()

    def write_tcl(self):
        # https://opensees.berkeley.edu/wiki/index.php/Elastic_Timoshenko_Beam_Column_Element

        material = self.CrossSection.material.write_tcl()
        section = self.CrossSection.write_tcl()
        geomTransf = self.geomTransf_tcl()
        integration = self.beamIntegrationNewtonCotes_tcl(5)

        beam = "element forceBeamColumn {} {} {} {} {} -mass {}\n".format(self.eleTag,
                                                                          self.iNode,
                                                                          self.jNode,
                                                                          self.transfTag,
                                                                          integration,
                                                                          self.massDens)
        

        return material + section + geomTransf + beam

    def write_py(self):

        material = self.CrossSection.material.write_py()
        section = self.CrossSection.write_py()
        geomTransf = self.geomTransf_py()
        integration = self.beamIntegrationNewtonCotes_py(5)
        
        beam = "ops.element('forceBeamColumn', {}, {}, {}, {}, {}, '-mass', {})\n".format(self.eleTag,
                                                                                         self.iNode,
                                                                                         self.jNode,
                                                                                         self.transfTag,
                                                                                         self.integrationTag,
                                                                                         self.massDens)
    

    
        return material + section + geomTransf + integration + beam



class ShellMITC4(object):
    def __init__(self, Mesh, CrossSection, Colour):

        self.Mesh = Mesh
        self.CrossSection = CrossSection
        self.Colour = Colour

        self.type = "Shell"

        self.ndf = 6
        
        self.eleTag = None
        self.indexNodes = []

        self.elementType = "ShellMITC4"

    def setTopology(self, cloudPoint):
        self.indexNodes = []
        vertices = self.Mesh.Vertices.ToPoint3dArray()
        for node in vertices:
            self.indexNodes.append( cloudPoint.ClosestPoint(node) + 1 )
        pass
    
    def setTags(self):

        self.CrossSection.sectionTag = self.eleTag
        self.CrossSection.material.matTag = self.eleTag

        #self.CrossSection.sectionTag = index
        #self.CrossSection.material.matTag = index
        pass

    def ToString(self):
        return "Class ShellMITC4"

    def write_tcl(self):
        # https://opensees.berkeley.edu/wiki/index.php/Shell_Element
        # element ShellMITC4 $eleTag $iNode $jNode $kNode $lNode $secTag

        material = self.CrossSection.material.write_tcl()
        section = self.CrossSection.write_tcl()

        shell = "element ShellMITC4 {} {} {} {} {} {}\n".format(self.eleTag, self.indexNodes[0], self.indexNodes[1], self.indexNodes[2], self.indexNodes[3], self.CrossSection.sectionTag)

        return material + section + shell

    def write_py(self):

        material = self.CrossSection.material.write_py()
        section = self.CrossSection.write_py()

        shell =  "ops.element('ShellMITC4', {}, {}, {}, {}, {}, {})\n".format(self.eleTag, self.indexNodes[0], self.indexNodes[1], self.indexNodes[2], self.indexNodes[3], self.CrossSection.sectionTag)

        return material + section + shell

class ASDShellQ4(object):
    def __init__(self, Mesh, CrossSection, Colour):

        self.Mesh = Mesh
        self.CrossSection = CrossSection
        self.Colour = Colour

        self.type = "Shell"

        self.ndf = 6
        
        self.eleTag = None
        self.indexNodes = []

        self.elementType = "ASDShellQ4"

    def setTopology(self, cloudPoint):
        self.indexNodes = []
        vertices = self.Mesh.Vertices.ToPoint3dArray()
        for node in vertices:
            self.indexNodes.append( cloudPoint.ClosestPoint(node) + 1 )
        pass
    
    def setTags(self):

        self.CrossSection.sectionTag = self.eleTag
        self.CrossSection.material.matTag = self.eleTag

        #self.CrossSection.sectionTag = index
        #self.CrossSection.material.matTag = index
        pass

    def ToString(self):
        return "Class ASDShellQ4"

    def write_tcl(self):
        # https://opensees.berkeley.edu/wiki/index.php/Shell_Element
        # element ASDShellQ4 $eleTag $iNode $jNode $kNode $lNode $secTag

        material = self.CrossSection.material.write_tcl()
        section = self.CrossSection.write_tcl()

        shell = "element ASDShellQ4 {} {} {} {} {} {}\n".format(self.eleTag, self.indexNodes[0], self.indexNodes[1], self.indexNodes[2], self.indexNodes[3], self.CrossSection.sectionTag)

        return material + section + shell

    def write_py(self):

        material = self.CrossSection.material.write_py()
        section = self.CrossSection.write_py()

        shell =  "ops.element('ASDShellQ4', {}, {}, {}, {}, {}, {})\n".format(self.eleTag, self.indexNodes[0], self.indexNodes[1], self.indexNodes[2], self.indexNodes[3], self.CrossSection.sectionTag)

        return material + section + shell


class ShellNLDKGT(object):
    def __init__(self, Mesh, CrossSection, Colour):

        self.Mesh = Mesh
        self.CrossSection = CrossSection
        self.Colour = Colour

        self.type = "Shell"

        self.ndf = 6
        
        self.eleTag = None
        self.indexNodes = []

        self.elementType = "ShellDKGT"

    def setTopology(self, cloudPoint):
        self.indexNodes = []
        vertices = self.Mesh.Vertices.ToPoint3dArray()
        for node in vertices:
            self.indexNodes.append( cloudPoint.ClosestPoint(node) + 1 )
        pass
    
    def setTags(self):

        self.CrossSection.sectionTag = self.eleTag
        self.CrossSection.material.matTag = self.eleTag

        pass

    def ToString(self):
        return "Class ShellDKGT"

    def write_tcl(self):
        # https://opensees.berkeley.edu/wiki/index.php/ShellNLDKGT
        # element ShellNLDKGT $eleTag $iNode $jNode $kNode $lNode $secTag

        material = self.CrossSection.material.write_tcl()
        section = self.CrossSection.write_tcl()

        shell = "element ShellDKGT {} {} {} {} {}\n".format(self.eleTag, self.indexNodes[0], self.indexNodes[1], self.indexNodes[2], self.CrossSection.sectionTag)

        return material + section + shell

    def write_py(self):

        material = self.CrossSection.material.write_py()
        section = self.CrossSection.write_py()

        shell =  "ops.element('ShellDKGT', {}, {}, {}, {}, {})\n".format(self.eleTag, self.indexNodes[0], self.indexNodes[1], self.indexNodes[2], self.CrossSection.sectionTag)

        return material + section + shell


class stdBrick(object):
    def __init__(self, Brick, material, Colour):

        self.Mesh = Brick
        self.material = material
        self.type = "Brick"

        self.ndf = 3

        self.Colour = Colour

        self.eleTag = None
        self.indexNodes = []

        self.elementType = "stdBrick"
        
            
    def setTopology(self, cloudPoints):
        indexNodes = []
        for iPoint in self.Mesh.Vertices:
            indexNodes.append( cloudPoints.ClosestPoint(iPoint) + 1)
        self.indexNodes = indexNodes
        pass

    def setTags(self):
        # not sure if this can create some problem
        # have a look at copy the object
        self.material.matTag = self.eleTag
        pass
    
    def ToString(self):
        return self.write_tcl()
    
    def write_tcl(self):
        material = self.material.write_tcl()
        brick = "element {} {} {} {} {} {} {} {} {} {} {} {} {} {}\n".format( self.elementType, self.eleTag, self.indexNodes[0], self.indexNodes[1], self.indexNodes[2], self.indexNodes[3], self.indexNodes[4], self.indexNodes[5], self.indexNodes[6], self.indexNodes[7], self.material.matTag, 0, 0, 0)
        return material + brick

    def write_py(self):
        material = self.material.write_py()
        brick = "ops.element('{}', {}, *{}, {}, {}, {}, {})\n".format( self.elementType, self.eleTag, self.indexNodes, self.material.matTag, 0, 0, 0)
        return  material + brick


class SSPbrick(object):
    def __init__(self, Brick, material, Colour):

        self.Mesh = Brick
        self.material = material
        self.type = "Brick"

        self.ndf = 3

        self.Colour = Colour

        self.eleTag = None
        self.indexNodes = []

        self.elementType = "SSPbrick"
        
            
    def setTopology(self, cloudPoints):
        indexNodes = []
        for iPoint in self.Mesh.Vertices:
            indexNodes.append( cloudPoints.ClosestPoint(iPoint) + 1)
        self.indexNodes = indexNodes
        pass

    def setTags(self):
        # not sure if this can create some problem
        # have a look at copy the object
        self.material.matTag = self.eleTag
        pass
    
    def ToString(self):
        return self.write_tcl()
    
    def write_tcl(self):
        material = self.material.write_tcl()
        brick = "element {} {} {} {} {} {} {} {} {} {} {} {} {} {}\n".format( self.elementType, self.eleTag, self.indexNodes[0], self.indexNodes[1], self.indexNodes[2], self.indexNodes[3], self.indexNodes[4], self.indexNodes[5], self.indexNodes[6], self.indexNodes[7], self.material.matTag, 0, 0, 0)
        return material + brick

    def write_py(self):
        material = self.material.write_py()
        brick = "ops.element('{}', {}, *{}, {}, {}, {}, {})\n".format( self.elementType, self.eleTag, self.indexNodes, self.material.matTag, 0, 0, 0)
        return  material + brick



class FourNodeTetrahedron(object):
    def __init__(self, Tetra, material, Colour):

        self.Mesh = Tetra
        self.material = material
        self.type = "Brick"

        self.ndf = 3

        self.Colour = Colour

        self.eleTag = None
        self.indexNodes = []

        self.elementType = "FourNodeTetrahedron"
            
    def setTopology(self, cloudPoints):
        indexNodes = []
        for iPoint in self.Mesh.Vertices:
            indexNodes.append( cloudPoints.ClosestPoint(iPoint) + 1)
        self.indexNodes = indexNodes
        pass

    def setTags(self):
        # not sure if this can create some problem
        # have a look at copy the object
        self.material.matTag = self.eleTag
        pass
    
    def ToString(self):
        return self.write_py()
    
    def write_tcl(self):
        material = self.material.write_tcl()
        brick = "element {} {} {} {} {} {} {} {} {} {}\n".format( self.elementType, self.eleTag, self.indexNodes[0], self.indexNodes[1], self.indexNodes[2], self.indexNodes[3], self.material.matTag, 0, 0, 0)
        return material + brick

    def write_py(self):
        material = self.material.write_py()
        brick = "ops.element('{}', {}, *{}, {}, {}, {}, {})".format( self.elementType, self.eleTag, self.indexNodes, self.material.matTag, 0, 0, 0)
        return  material + brick


class Support(object):
    def __init__(self, Pos, Tx = False, Ty = False, Tz = False, Rx = False, Ry = False, Rz = False):
        
        """Generate a Support Boundary Condition
            Inputs:
                Pos: Point Position.
                Tx =
                Ty = 
                Tz = 
                Mx = 
                My = 
                Mz = """
        
        self.Pos = Pos
        
        self.Tx = int(Tx)
        self.Ty = int(Ty)
        self.Tz = int(Tz)
        self.Rx = int(Rx)
        self.Ry = int(Ry)
        self.Rz = int(Rz)
        
        self.nodeTag = None

        self.ndf = None


    def setNodeTag(self, cloudPoint):
        self.nodeTag = cloudPoint.ClosestPoint(self.Pos) + 1
        pass

    ## override Rhino .ToString() method (display name of the class in Gh)
    def ToString(self):
        return "fix {} {} {} {} {} {} {}".format(self.nodeTag, self.Tx, self.Ty, self.Tz, self.Rx, self.Ry, self.Rz)

    def write_tcl(self):
        if self.ndf == 6:
            tcl_text = "fix {} {} {} {} {} {} {}".format(self.nodeTag, self.Tx, self.Ty, self.Tz, self.Rx, self.Ry, self.Rz)
        elif self.ndf == 3:
            tcl_text = "fix {} {} {} {}".format(self.nodeTag, self.Tx, self.Ty, self.Tz)
        else:
            raise ValueError('No ndf has been assigned')
        return tcl_text

    def write_py(self):
        if self.ndf == 6:
            py_text = "ops.fix({},{},{},{},{},{},{})".format(self.nodeTag, self.Tx, self.Ty, self.Tz, self.Rx, self.Ry, self.Rz)
        elif self.ndf == 3:
            py_text = "ops.fix({},{},{},{})".format(self.nodeTag, self.Tx, self.Ty, self.Tz)
        else:
            raise ValueError('No ndf has been assigned')
        return py_text


#####################################################
### Constraint  #####################################
#####################################################

#TODO 
#ASK FOR A PERP DIRECTION
class RigidDiaphragm(object):
    def __init__(self, masterNode, slaveNodes):
        self.masterNode = masterNode
        self.slaveNodes = slaveNodes

        self.masterNodeTag = None
        self.slaveNodesTag = []
        
        # It is assuming that Diaphgram is Horizontal
        self.perDir = 3 
    
    def setNodeTag(self, cloudPoint):
        
        self.masterNodeTag = cloudPoint.ClosestPoint(self.masterNode) + 1
        for node in self.slaveNodes:
            self.slaveNodesTag.append(cloudPoint.ClosestPoint(node) + 1)
        return
    
    def ToString(self):
        return self.write_tcl()
    
    def write_tcl(self):
        slaveNodesTag = [str(x) for x in self.slaveNodesTag]
        slaveNodesTag = ' '.join(slaveNodesTag)
        tcl_text = "rigidDiaphragm {} {}  {}\n".format(self.perDir, self.masterNodeTag, slaveNodesTag)
        return tcl_text

    def write_py(self):
        py_text = "ops.rigidDiaphragm({}, {}, *{})".format(self.perDir, self.masterNodeTag, self.slaveNodesTag)
        return py_text

#TODO write TCL
class EqualDOF(object):
    def __init__(self, masterNode, slaveNodes, dof_x, dof_y, dof_z, dof_xx, dof_yy, dof_zz):
        self.masterNode = masterNode
        self.slaveNodes = slaveNodes

        self.dof_x = dof_x
        self.dof_y = dof_y
        self.dof_z = dof_z
        self.dof_xx = dof_xx
        self.dof_yy = dof_yy
        self.dof_zz = dof_zz

        self.dof = [self.dof_x, self.dof_y, self.dof_z, self.dof_xx, self.dof_yy, self.dof_zz] 

        self.masterNodeTag = None
        self.slaveNodesTag = None

    def setNodeTag(self, cloudPoint):
        
        self.masterNodeTag = cloudPoint.ClosestPoint(self.masterNode) + 1
        self.slaveNodesTag.append(cloudPoint.ClosestPoint(self.slaveNodes) + 1)
        return

    def ToString(self):
        return self.write_tcl()
    
    def write_tcl(self):
        dofs = []
        for i,dof in enumerate(self.dof,1):
            if dof == True:
                dofs.append(i)

        dofs = ' '.join([str(i) for i in dofs])
        tcl_text = "equalDOF {} {}  {}\n".format(self.masterNodeTag, self.slaveNodesTag, dofs)
        return tcl_text

    def write_py(self):
        py_text = "ops.equalDOF({}, {}, *{})".format(self.masterNodeTag, self.slaveNodesTag, self.dof)
        return py_text


#####################################################
### Cross Section ###################################
#####################################################

#TODO
class CircleCS(object):
    def __init__(self, d, t, material = None):

        self.d = d
        self.t = t
        self.shape = 'circular'
        self.material = material

        self.alphaY = 9.0/10.0
        self.alphaZ = 9.0/10.0

        self.crv = rg.Circle(rg.Plane.WorldXY, self.d/2.0).ToNurbsCurve( 2, 10 )
        self.sectionBrep = rg.Brep.CreatePlanarBreps( self.crv, 0.1 )[0]
        
    def Area(self):
        if self.t == 0 or self.t == self.d / 2:
            Area = math.pow(self.d,2)/4  * math.pi
        elif self.t < self.d/2 and self.t >= 0:
            Area = (pow(self.d,2)-pow((self.d-2*self.t),2))/4 * math.pi
        else:
            Area = None
        return Area

    def AreaY(self):
        return self.Area() * self.alphaY

    def AreaZ(self):
        return self.Area() * self.alphaZ

    def Iyy(self):
        if self.t == 0 or self.t == self.d / 2:
            Iyy = pow(self.d,4)/64 * math.pi
        elif self.t < self.d/2 and self.t >= 0:
            Iyy = (pow(self.d,4)-pow((self.d-2*self.t),4))/64 * math.pi
        else:
            Iyy = None
        return Iyy

    def Izz(self):
        Izz = self.Iyy()
        return Izz

    def J(self):
        if self.t == 0 or self.t == self.d / 2:
            J = pow(self.d,4)/32 * math.pi
        elif self.t < self.d/2 and self.t >= 0:
            J = (pow(self.d,4)-pow((self.d-2*self.t),4))/32 * math.pi
        else:
            J = None
        return J

    def write_tcl(self):
        pass

    def write_py(self):
        pass

    def ToString(self):
        return "Class CircleCS: \
                \n\tshape: {0} \
                \n\tdiameter: {1} \
                \n\tthickness: {2} \
                \n\tArea {3} \
                \n\tAreaY {4} \
                \n\tAreaZ {5} \
                \n\tIyy {6} \
                \n\tIzz {7} \
                \n\tJ {8}".format(self.shape, self.d, self.t, round(self.Area(),3), round(self.AreaY(),3), round(self.AreaZ(),3), round(self.Iyy(),3), round(self.Izz(),3), round(self.J(),3))


#TODO
class RectangularCS(object):
    def __init__(self, b, h, material = None):

        self.b = b
        self.h = h
        self.shape = "Rectangular"
        self.material = material

        self.alphaY = 5.0/6.0
        self.alphaZ = 5.0/6.0


        widthDomain = rg.Interval(-b/2,b/2)
        heightDomain = rg.Interval(-h/2,h/2)
        self.crv = rg.Rectangle3d(rg.Plane.WorldXY, widthDomain, heightDomain).ToNurbsCurve()
        self.sectionBrep = rg.Brep.CreatePlanarBreps( self.crv, 0.1 )[0]
    def Area(self):
        return self.b * self.h

    def AreaY(self):
        return self.Area() * self.alphaY

    def AreaZ(self):
        return self.Area() * self.alphaZ

    def Iyy(self):
        return self.b*pow(self.h,3)/12

    def Izz(self):
        return pow(self.b,3)*self.h/12

    def J(self):
        if self.h < self.b:
            k = 1 / (3+4.1*pow((self.h/self.b),3/2))
            J = k*self.b*pow(self.h,3)
        else:
            k = 1 / (3+4.1*pow((self.b/self.h),3/2))
            J = k*self.h*pow(self.b,3)
        return J
    


    def ToString(self):
        return "Class RectangularCS: \
                \n\tshape: {0} \
                \n\tbase: {1} \
                \n\theight: {2} \
                \n\tArea {3} \
                \n\tAreaY {4} \
                \n\tAreaZ {5} \
                \n\tIyy {6} \
                \n\tIzz {7} \
                \n\tJ {8}".format(self.shape, self.b, self.h, round(self.Area(),3), round(self.AreaY(),3), round(self.AreaZ(),3), round(self.Iyy(),3), round(self.Izz(),3), round(self.J(),3))

    def write_tcl(self):
        pass

    def write_py(self):
        pass



class ElasticSection(object):
    def __init__(self, secName, Area, Izz, Iyy, J, alphaY, alphaZ, material):

        self.secName = secName
        self.Area = Area
        self.Izz = Izz
        self.Iyy = Iyy
        self.J = J
        self.alphaY = alphaY
        self.alphaZ = alphaZ

        self.material = material
    
        self.AreaY = Area * alphaY
        self.AreaZ = Area * alphaZ

        self.crv = None
        self.sectionBrep = None

        self.sectionTag = None

    def ToString(self):
        return self.write_tcl()

    def write_tcl(self):
        tcl_text = "section Elastic {} {} {} {} {} {} {} {} {}\n".format(self.sectionTag, self.material.E, self.Area, self.Izz, self.Iyy, self.material.G, self.J, self.alphaY, self.alphaZ)
        return tcl_text

    def write_py(self):
        py_text = "ops.section('Elastic',{},{},{},{},{},{},{},{},{})\n".format(self.sectionTag, self.material.E, self.Area, self.Izz, self.Iyy, self.material.G, self.J, self.alphaY, self.alphaZ)
        return py_text


#TODO
class PlateFiberSection(object):
    def __init__(self, sectionName, height, material):

        self.sectionName = sectionName
        self.height = height
        self.material = material
        
        self.sectionTag = None

    def ToString(self):
        return self.write_tcl()

    def write_tcl(self):
        # https://opensees.berkeley.edu/wiki/index.php/Plate_Fiber_Section
        #       section PlateFiber $secTag $matTag $h
        return "section PlateFiber {} {} {}\n".format(self.sectionTag, self.material.matTag, self.height)

    def write_py(self):
        return "ops.section('PlateFiber',{},{},{})\n".format(self.sectionTag, self.material.matTag, self.height)

#TODO
class ElasticMembranePlateSection(object):
    def __init__(self, sectionName, height, material):

        self.sectionName = sectionName
        self.material = material
        self.height = height

        self.sectionTag = None

    def ToString(self):
        return self.write_tcl()

    def write_tcl(self):
        # https://opensees.berkeley.edu/wiki/index.php/Elastic_Membrane_Plate_Section
        #       section ElasticMembranePlateSection {$secTag} {$E} {$n} {$h} {$rho}
        return "section ElasticMembranePlateSection {} {} {} {} {}\n".format(self.sectionTag, self.material.E, self.material.v, self.height, self.material.rho)

    def write_py(self):
        return "ops.section('ElasticMembranePlateSection',{},{},{},{},{})\n".format(self.sectionTag, self.material.E, self.material.v, self.height, self.material.rho)

#TODO
class LayeredShell(object):
    def __init__(self, sectionName, materials, thicknesses):

        self.sectionName = sectionName
        self.materials = materials
        self.thicknesses = thicknesses

        self.numLayer = None
        self.sectionTag = None

    def ToString(self):
        return self.write_tcl()

    def write_tcl(self):
        # http://www.luxinzheng.net/download/OpenSEES/En_THUShell_OpenSEES.htm
        # section LayeredShell $sectionTag $nLayers $matTag1 $thickness1...$matTagn $thicknessn
        
        subDividedThickness = []
        for layerThickness in self.thicknesses:
            tempThick = []
            subLayerThickness = layerThickness/3
            tempThick.append(subLayerThickness)
            tempThick = tempThick * 3
            subDividedThickness.append(tempThick)
        
        
        numLayer = 0
        for listElem in subDividedThickness:
            numLayer += len(listElem)

        self.numLayer = numLayer
            
        
        tcl_text = "section LayeredShell {} {} ".format(self.sectionTag, numLayer)
        for i in range(len(self.materials)):
            for j in range(len(subDividedThickness)):
                
                tcl_text += str(self.materials[i].matTag) + " "
                tcl_text += str(subDividedThickness[i][j]) + " "
        
        tcl_text += "\n"
        
        return tcl_text 


    def write_py(self):
        
        subDividedThickness = []
        for layerThickness in self.thicknesses:
            tempThick = []
            subLayerThickness = layerThickness/3
            tempThick.append(subLayerThickness)
            tempThick = tempThick * 3
            subDividedThickness.append(tempThick)
        
        
        numLayer = 0
        for listElem in subDividedThickness:
            numLayer += len(listElem)
        
        self.numLayer = numLayer
        
        py_text = "ops.section('LayeredShell',{},{}, ".format(self.sectionTag, numLayer)
        for i in range(len(self.materials)):
            for j in range(len(subDividedThickness)):
                
                py_text += str(self.materials[i].matTag) + ","
                py_text += str(subDividedThickness[i][j]) + ","
        py_text = py_text[:-1]
        py_text += ")\n"

        return py_text 


# to define 2d elastic section

#####################################################################
### Load ############################################################
#####################################################################

class PointLoad(object):
    def __init__(self, Pos, Force, Moment, TimeSeries):

        self.Pos = Pos
        self.Force = Force
        self.Moment = Moment

        self.nodeTag = None

        self.type = "PointLoad"

        self.ndf = None

        self.PatternTag = None
        self.TimeSeries = TimeSeries


    def setNodeTag(self, cloudPoint):
        self.nodeTag = cloudPoint.ClosestPoint(self.Pos) + 1
        pass

    #TODO
    # Allowing for more than one time series
    @staticmethod
    def write_py(groupsTimeSeries):

        text = []

        for timeSeries in groupsTimeSeries.keys():
            text.append(groupsTimeSeries[timeSeries][0].TimeSeries.write_py())
            text.append("ops.pattern('Plain',{},{})".format(timeSeries, timeSeries)) #patternTag, TimeSeriesTag
            for load in groupsTimeSeries[timeSeries]:
                text.append("ops.load(%s, %s, %s, %s, %s, %s, %s)" % (load.nodeTag, load.Force.X, load.Force.Y, load.Force.Z, load.Moment.X, load.Moment.Y, load.Moment.Z))

        text = "\n".join(text)

        return text

    def ToString(self):
        return "<Class PointLoad>"

    """
    #TODO add the ndf dispatch for writing the load
    @staticmethod
    def write_tcl(groupsTimeSeries, model):

        text = []

        for timeSeries in groupsTimeSeries.keys():
            text.append(groupsTimeSeries[timeSeries][0].TimeSeries.write_tcl())
            text.append("pattern Plain %s %s {" % (timeSeries, timeSeries)) #patternTag, TimeSeriesTag
            for load in groupsTimeSeries[timeSeries]:
                if model.uniquePointsThreeNDF.Contains(load.Pos):
                    text.append("\tload %s %s %s %s" % (load.nodeTag, load.Force.X, load.Force.Y, load.Force.Z))
                elif model.uniquePointsSixNDF.Contains(load.Pos):
                    text.append("\tload %s %s %s %s %s %s %s" % (load.nodeTag, load.Force.X, load.Force.Y, load.Force.Z, load.Moment.X, load.Moment.Y, load.Moment.Z))
            text.append("}")
        text = "\n".join(text)

        return text
        """

    #TODO add the ndf dispatch for writing the load
    @staticmethod
    def write_tcl(groupsTimeSeries, model):

        text = []

        for timeSeries in groupsTimeSeries.keys():
            text.append(groupsTimeSeries[timeSeries][0].TimeSeries.write_tcl())
            text.append("pattern Plain %s %s {" % (timeSeries, timeSeries)) #patternTag, TimeSeriesTag
            for load in groupsTimeSeries[timeSeries]:
                if model.uniquePointsThreeNDF:
                    if load.Pos.DistanceTo(Rhino.Collections.Point3dList.ClosestPointInList(model.uniquePointsThreeNDF,load.Pos)) < 0.001:
                        text.append("\tload %s %s %s %s" % (load.nodeTag, load.Force.X, load.Force.Y, load.Force.Z))
                elif load.Pos.DistanceTo(Rhino.Collections.Point3dList.ClosestPointInList(model.uniquePointsSixNDF,load.Pos)) < 0.001:
                    text.append("\tload %s %s %s %s %s %s %s" % (load.nodeTag, load.Force.X, load.Force.Y, load.Force.Z, load.Moment.X, load.Moment.Y, load.Moment.Z))
            text.append("}")
        text = "\n".join(text)

        return text


#####################################################################
### Analysis ########################################################
#####################################################################


class Analysis(object):
    def __init__(self, Constraint, Numberer, System, Test, Algorithm, Integrator, AnalysisType, NumberOfSteps):

        self.Constraint = Constraint
        self.Numberer = Numberer
        self.System = System
        self.Test = Test
        self.Algorithm = Algorithm
        self.Integrator = Integrator
        self.AnalysisType = AnalysisType
        self.NumberOfSteps = NumberOfSteps

    def ToString(self):
        return "<Class Analyses>"

    def write_tcl(self):
        Constraint = "constraints {}\n".format(self.Constraint)
        Numberer = "numberer {}\n".format(self.Numberer)
        System = "system {}\n".format(self.System)
        Test = "test {}\n".format(self.Test)
        Algorithm = "algorithm {}\n".format(self.Algorithm)
        Integrator = "integrator {}\n".format(self.Integrator)
        AnalysisType = "analysis {}\n".format(self.AnalysisType)
        NumberOfSteps = "analyze {}\n".format(self.NumberOfSteps)

        return Constraint + Numberer + System + Test + Algorithm + Integrator + AnalysisType + NumberOfSteps

    def write_py(self):
        Constraint = "ops.constraints( '{}' )\n".format(self.Constraint)
        Numberer = "ops.numberer( '{}' )\n".format(self.Numberer)
        System = "ops.system( '{}' )\n".format(self.System)
        Test = "ops.test( {} )\n".format(self.Test)
        Algorithm = "ops.algorithm( '{}' )\n".format(self.Algorithm)
        Integrator = "ops.integrator( {} )\n".format(self.Integrator)
        AnalysisType = "ops.analysis( '{}' )\n".format(self.AnalysisType)
        NumberOfSteps = "ops.analyze( {} )\n".format(self.NumberOfSteps)

        return Constraint + Numberer + System + Test + Algorithm + Integrator + AnalysisType + NumberOfSteps
    
#####################################################################
### Time Series #####################################################
#####################################################################


class TimeSeries(object):

    @staticmethod
    def getTimeSeries(Load):

        # Load is the list of Load that goes in the assemble

        groupsTimeSeries = defaultdict(list)

        for obj in Load:
            groupsTimeSeries[id(obj.TimeSeries)].append(obj)

        # change name to the dictionary and assign timeSeriesTag

        for i,value in enumerate(groupsTimeSeries.keys(),1):
            groupsTimeSeries[i] = groupsTimeSeries.pop(value)
            groupsTimeSeries[i][0].TimeSeries.timeSeriesTag = i
        

        # get the list of unique Time Series Object

        TimeSeries = []

        for i,item in enumerate(groupsTimeSeries.keys(),1):
            TimeSeries.append(groupsTimeSeries[i][0].TimeSeries)

        return TimeSeries, groupsTimeSeries
    


class TimeSeriesConstant(object):
    def __init__(self, cFactor):
        self.seriesType = "Constant"
        self.cFactor = cFactor
        self.timeSeriesTag = None

    def ToString(self):
        return self.write_tcl()

    def write_tcl(self):
        return "timeSeries Constant {} -factor {}\n".format(self.timeSeriesTag, self.cFactor)

    def write_py(self):
        return "ops.timeSeries('Constant',{},'-factor', {})\n".format(self.timeSeriesTag, self.cFactor)

class TimeSeriesLinear(object):
    def __init__(self, linearFactor):
        self.seriesType = "linear"
        self.linearFactor = linearFactor
        self.timeSeriesTag = None

    def ToString(self):
        return self.write_tcl()

    def write_tcl(self):
        return "timeSeries Linear {} -factor {}\n".format(self.timeSeriesTag, self.linearFactor)

    def write_py(self):
        return "ops.timeSeries('Linear',{},'-factor', {})\n".format(self.timeSeriesTag, self.linearFactor)

class TimeSeriesTrigonometric(object):
    def __init__(self, tStart, tEnd, period, factor, shift):
        self.seriesType = "Trig"
        self.timeSeriesTag = None

        self.tStart = tStart
        self.tEnd = tEnd

        self.period = period
        self.factor = factor
        self.shift = shift

    def ToString(self):
        return self.write_tcl()

    def write_tcl(self):
        return "timeSeries Trig {} {} {} {} -factor {} -shift {}\n".format(self.timeSeriesTag, self.tStart, self.tEnd, self.period, self.factor, self.shift)

    def write_py(self):
        return "ops.timeSeries('Trig', {}, {}, {}, {}, '-factor', {}, '-shift', {})\n".format(self.timeSeriesTag, self.tStart, self.tEnd, self.period, self.factor, self.shift)

#TODO
#TO CHECK HOW THE LIST WORKS IN TCL
class TimeSeriesPath(object):
    def __init__(self, values, time, factor):
        self.seriesType = "path"
        self.values = values
        self.time = time
        self.factor = factor
        self.timeSeriesTag = None
    
    def ToString(self):
        return self.write_tcl()

    def write_tcl(self):
        time = [str(x) for x in self.time]
        time = ' '.join(time)
        
        values = [str(x) for x in self.values]
        values = ' '.join(values)
        tcl_text = "timeSeries Path %s -time {%s} -values {%s} -factor %s\n" % (self.timeSeriesTag, time, values, self.factor)
        return tcl_text

    def write_py(self):
        py_text = "ops.timeSeries('Path', {}, '-values', *{}, '-time', *{}, '-factor', {})".format(self.timeSeriesTag, self.values, self.time, self.factor)
        return py_text





###################################################################
###################################################################
###################################################################

class PYRecorder(object):

    @staticmethod
    def node(fileName, nodeTag, dof, respType):
        return "ops.recorder('Node', '-file', '{}', '-time', '-node', {}, '-dof', {}, '{}')".format(fileName, nodeTag, dof, respType)

    @staticmethod
    def element(fileName, eleTag, respType):
        return "ops.recorder('Element', '-file', '{}', '-time', '-ele', {}, '{}')".format(fileName, eleTag, respType)


class PYRecorder_mod(object):

    def __init__(self):

        self.filename = None
        self.respType = None


    def node(self, fileName, nodeTag, dof, respType):

        self.filename = fileName
        self.respType = respType

        return "ops.recorder('Node', '-file', '{}', '-time', '-node', {}, '-dof', {}, '{}')".format(fileName, nodeTag, dof, respType)


    def element(self, fileName, eleTag, respType):

        self.filename = fileName
        self.respType = respType

        return "ops.recorder('Element', '-file', '{}', '-time', '-ele', {}, '{}')".format(fileName, eleTag, respType)


#TODO
#TO ADD THE ELEMENT RECORDER
class TCLRecorder(object):

    @staticmethod
    def mpco(recorderName, displacement, rotation, reactionForce, reactionMoment, modesOfVibration, modesOfVibrationRotational, force, stresses, sectionForce, sectionFiberStress):

        nodeRespType = ''

        if displacement:
            nodeRespType += ' displacement'

        if rotation:
            nodeRespType += ' rotation'

        if reactionForce:
            nodeRespType += ' reactionForce'

        if reactionMoment:
            nodeRespType += ' reactionMoment'

        if modesOfVibration:
            nodeRespType += ' modesOfVibration'

        if modesOfVibrationRotational:
            nodeRespType += ' modesOfVibrationRotational'
        
        elementRespType = ''

        if force:
            elementRespType += ' force'

        if stresses:
            elementRespType += ' stresses'

        if sectionForce:
            elementRespType += ' section.force'
        
        if sectionFiberStress:
            elementRespType += ' section.fiber.stress'
        


        if nodeRespType:
            return "recorder mpco {} -N {} -E {}".format(recorderName, nodeRespType, elementRespType)
# ---------- end python_7 ----------
data = Data(python_6.model)
# Linear           = "Linear"
# Newton           = "Newton"
# NewtonLineSearch = "NewtonLineSearch"
# ModifiedNewton   = "ModifiedNewton"
# KrylovNewton     = "KrylovNewton"
# SecantNewton     = "SecantNewton"
# BFGS             = "BFGS"
# Broyden          = "Broyden"
lc = LoadControlIntegratorAlpaca4d()  # -> out, Integrator; inputs numIter: Int32
# ---------- lc: Python ----------
"""Load Control Integrator
-
    Inputs:
        x:
        y:
    Output:
        Integrator:
"""

import sys
import os
import System
from System.Drawing import Color


import clr
import clrtype
import Rhino.Geometry as rg
import rhinoscriptsyntax as rs
import Grasshopper as gh
import copy
import ghpythonlib.treehelpers as th


ghenv.Component.Name = "Load Control Integrator (Alpaca4d)"
ghenv.Component.NickName = 'LC'
ghenv.Component.Message = "Load Control Integrator \n(Alpaca4d)"


numIter = "" if numIter is None else numIter
minLambda = "" if minLambda is None else minLambda
maxLambda = "" if maxLambda is None else maxLambda



checkData = True

if not Lambda:
    checkData = False
    msg = "Input parameter Lambda failed to collect data"
    ghenv.Component.AddRuntimeMessage(gh.Kernel.GH_RuntimeMessageLevel.Warning, msg)


if checkData:
    Integrator = "LoadControl {} {} {} {}".format(Lambda, numIter, minLambda, maxLambda)
# ---------- end lc ----------
ni = NewmarkIntegratorAlpaca4d()  # -> out, Integrator
# ---------- ni: Python ----------
"""
Define the Analyses Step
-
    Inputs:
        gamma:
        beta:
    Output:
        Integrator:
"""

import sys
import os
import System
from System.Drawing import Color


import clr
import clrtype
import Rhino.Geometry as rg
import rhinoscriptsyntax as rs
import Grasshopper as gh
import copy
import ghpythonlib.treehelpers as th



ghenv.Component.Name = "Newmark Integrator (Alpaca4d)"
ghenv.Component.NickName = 'NI'
ghenv.Component.Message = "Newmark Integrator \n(Alpaca4d)"



checkData = True

if not gamma:
    checkData = False
    msg = "Input parameter gamma failed to collect data"
    ghenv.Component.AddRuntimeMessage(gh.Kernel.GH_RuntimeMessageLevel.Warning, msg)

if not beta:
    checkData = False
    msg = "Input parameter beta failed to collect data"
    ghenv.Component.AddRuntimeMessage(gh.Kernel.GH_RuntimeMessageLevel.Warning, msg)


if checkData:
    Integrator = "Newmark {} {}".format(gamma, beta)
# ---------- end ni ----------
as = AnalysesStepAlpaca4d(numIncr="5")  # -> out, AnalysisSteps; inputs numIncr: Int32
# ---------- as: Python ----------
"""
Define the Analysis Step
-
    Inputs:
        numIncr:
        dt:
        dtMin:
        dtMAx:
        Jd:
    Output:
        AnalysisSteps:
"""

import sys
import os
import System
from System.Drawing import Color


import clr
import clrtype
import Rhino.Geometry as rg
import rhinoscriptsyntax as rs
import Grasshopper as gh
import copy
import ghpythonlib.treehelpers as th



ghenv.Component.Name = "Analyses Step (Alpaca4d)"
ghenv.Component.NickName = 'AS'
ghenv.Component.Message = "Analyses Step \n(Alpaca4d)"


dt = "" if dt is None else dt
dtMin = "" if dtMin is None else dtMin
dtMax = "" if dtMax is None else dtMax
Jd = "" if Jd is None else Jd

checkData = True

if not numIncr:
    checkData = False
    msg = "Input parameter numIncr failed to collect data"
    ghenv.Component.AddRuntimeMessage(gh.Kernel.GH_RuntimeMessageLevel.Warning, msg)

if checkData:
    AnalysisSteps = "{} {} {} {} {}".format(numIncr, dt, dtMin, dtMax, Jd)
# ---------- end as ----------
cd = CentralDifferenceAlpaca4d()  # -> out, Integrator
# ---------- cd: Python ----------
"""
Define the Analyses Step
-
    Inputs:
        gamma:
        beta:
    Output:
        Integrator:
"""

import sys
import os
import System
from System.Drawing import Color


import clr
import clrtype
import Rhino.Geometry as rg
import rhinoscriptsyntax as rs
import Grasshopper as gh
import copy
import ghpythonlib.treehelpers as th



ghenv.Component.Name = "Central Difference (Alpaca4d)"
ghenv.Component.NickName = 'CD'
ghenv.Component.Message = "Central Difference \n(Alpaca4d)"



checkData = True


if checkData:
    Integrator = "CentralDifference"
# ---------- end cd ----------
cd_2 = CentralDifferenceAlpaca4d()  # -> out, Integrator; same code as cd

# ----
# if you modify the screen
update = Button()

as_2 = AnalysisSettingsAlpaca4d(AnalysisSteps=as.AnalysisSteps)  # -> out, Analysis
# ---------- as_2: Python ----------
"""
Create Analysis settings
-
    Args:
        Constraint: 'Plain', 'Transformation'. Default is 'Transformation'.
        Numberer: 'RCM', 'AMD', 'Plain'. Default is 'RCM'.
        System: 'BandGen', 'BandSPD', 'ProfileSPD', 'SuperLU', 'UmfPack', 'FullGeneral', 'SparseSYM'. Default is 'BandSPD'.
        Test: Feature not implemented. Please contact alpaca4d@gmail.com 
        Algorithm: 'Linear', 'Newton', 'NewtonLineSearch', 'ModifiedNewton', 'KrylovNewton', 'SecantNewton', 'BFGS', 'Broyden'. Default is 'Linear'.
        Integrator: Default is LoadControl.
        AnalysisType: 'Static', 'Transient'. Default is 'Static'.
        AnalyesSteps:
    Returns:
        Analysis:
"""

import sys
import os


import clr
import clrtype
import Rhino.Geometry as rg
import rhinoscriptsyntax as rs
import Grasshopper as gh
import copy
import ghpythonlib.treehelpers as th


ghenv.Component.Name = "Analysis settings (Alpaca4d)"
ghenv.Component.NickName = 'AS'
ghenv.Component.Message = "Analysis settings \n(Alpaca4d)"



from Alpaca4d import alpaca4d as alpaca

checkData = True


# default Value
Constraint = 'Transformation' if Constraint is None else Constraint
ConstraintList = ['Plain', 'Transformation']

for item in ConstraintList:
    if Constraint.lower() == item.lower():
        print(item)
        Constraint = item


# default Value
Numberer = 'RCM' if Numberer is None else Numberer
NumbererList = ['RCM', 'AMD', 'Plain', 'ParallelPlain', 'ParallelRCM']

for i,item in enumerate(NumbererList):
    if Numberer.lower() == item.lower():
        Numberer = item



# default Value
System = 'BandSPD' if System is None else System
SystemList = ['BandGen', 'BandSPD', 'ProfileSPD', 'SuperLU', 'UmfPack', 'FullGeneral', 'SparseSYM']

for i,item in enumerate(SystemList):
    if System.lower() == item.lower():
        System = item


# default Test
Test = 'NormDispIncr 1.0e-6 12 5' if Test is None else Test




# default Value
Algorithm = 'Linear' if Algorithm is None else Algorithm
AlgorithmList = ['Linear', 'Newton', 'NewtonLineSearch', 'ModifiedNewton', 'KrylovNewton', 'SecantNewton', 'BFGS', 'Broyden']

for i,item in enumerate(AlgorithmList):
    if Algorithm.lower() == item.lower():
        Algorithm = item


# default Value
AnalysisType = 'Static' if AnalysisType is None else AnalysisType
AnalysisTypeList = ['Static', 'Transient']

for item in AnalysisTypeList:
    if AnalysisType.lower() == item.lower():
        AnalysisType = item


## Define Integrator
if AnalysisType == "Static":
    Integrator = "LoadControl 1.0" if Integrator is None else Integrator
elif AnalysisType == "Transien":
    Integrator = "Newmark 0.5 0.25" if Integrator is None else Integrator



if not AnalysisSteps:
    checkData = False
    msg = "Input parameter AnalysisSteps failed to collect data"
    ghenv.Component.AddRuntimeMessage(gh.Kernel.GH_RuntimeMessageLevel.Warning, msg)


if checkData:
    Analysis = alpaca.Analysis(Constraint, Numberer,System,Test,Algorithm,Integrator,AnalysisType, AnalysisSteps)
    print(Analysis.write_tcl())
# ---------- end as_2 ----------
data_2 = Data(data)
ra = RunAnalysisAlpaca4d(AlpacaModel=data_2, Analysis=as_2.Analysis)  # -> out, AlpacaSolvedModel
# ---------- ra: Python ----------
"""
Run an OpenSees Analysis
-
    Args:
        AlpacaModel:
        Analysis:
    Returns:
        AlpacaSolvedModel:
"""



import Rhino.RhinoDoc
import Grasshopper as gh
import copy
import rhinoscriptsyntax as rs
import os
import time
import sys



ghenv.Component.Name = "Run Analysis (Alpaca4d)"
ghenv.Component.NickName = 'RA'
ghenv.Component.Message = "Run Analysis \n(Alpaca4d)"

ghcompfolder = gh.Folders.DefaultAssemblyFolder
if ghcompfolder not in sys.path:
    sys.path.append(ghcompfolder)

try:
    from Alpaca4d import alpaca4d as alpaca
except:
    msg = "Cannot import Alpaca4d. Is the Alpaca4d folder available in " + ghcompfolder + "?"
    ghenv.Component.AddRuntimeMessage(gh.Kernel.GH_RuntimeMessageLevel.Error, msg)


checkData = True



if not AlpacaModel:
    checkData = False
    msg = "Input parameter AlpacaModel failed to collect data"
    ghenv.Component.AddRuntimeMessage(gh.Kernel.GH_RuntimeMessageLevel.Warning, msg)


if not Analysis:
    checkData = False
    msg = "Input parameter Analysis failed to collect data"
    ghenv.Component.AddRuntimeMessage(gh.Kernel.GH_RuntimeMessageLevel.Warning, msg)


if checkData:
    FolderPath = rs.DocumentPath()
    os.chdir(FolderPath)
    
    outputFileName = 'openSeesModel'
    
    for dirpath, dirnames, filenames in os.walk(FolderPath):
        for filename in filenames:
            if filename == outputFileName:
                file = os.path.join(dirpath,outputFileName)
                os.remove(file)
    
    
    # create a copy
    
    AnalysisModel = copy.copy(AlpacaModel)
    AnalysisModel.py = list(AnalysisModel.py)
    
    # generate Recorder and assign name
    AnalysisModel.recorderName = "recorder" + ".mpco"
    
    AnalysisModel.py.append(alpaca.TCLRecorder.mpco(AnalysisModel.recorderName, True,True,True,True,False,False,True,True,True,True))
    
    
    AnalysisModel.analysis = Analysis
    AnalysisModel.py.append(Analysis.write_tcl())
    #AnalysisModel.StaticAnalysis(numIncr)
    AnalysisModel.py.append("wipe")
    
    
    #textFile = AnalysisModel.py
    
    time_start = time.clock()
    
    AnalysisModel.writeFile(outputFileName)
    
    time_elapsed = (time.clock() - time_start)
    print("Writing Time {}".format(time_elapsed))
    
    
    
    time_start = time.clock()
    
    executable = os.path.join(ghcompfolder,'Alpaca4d\OpenSees-Solvers\opensees.bat')
    a, msg = AnalysisModel.runOpensees(executable)
    
    time_elapsed = (time.clock() - time_start)
    print("Analyses Time {}".format(time_elapsed))
    
    
    AlpacaSolvedModel = copy.copy(AnalysisModel)
#ghenv.Component.AddRuntimeMessage(gh.Kernel.GH_RuntimeMessageLevel.Error, msg)
# ---------- end ra ----------
ss = ShellStressesAlpaca4d()  # -> out, Mesh, p11, p22, p12, m11, m22, m12, q1, q2; inputs History: Boolean, step: Int32
# ---------- ss: Python ----------
"""
Read Shell Stresses
-
    Args:
        AlpacaModel:
        step:
    Returns:
        p11:
        p22:
        p12:
        m11:
        m22:
        m12:
        q1:
        q2:
"""

ghenv.Component.Name = "Shell Stresses (Alpaca4d)"
ghenv.Component.NickName = 'SS'
ghenv.Component.Message = "Shell Stress (Alpaca4d)"

import sys
import os
import System
from System.Drawing import Color


import clr
import clrtype
import Rhino.Geometry as rg
import rhinoscriptsyntax as rs
import Grasshopper as gh
import copy
import ghpythonlib.treehelpers as th


## add alpaca install directory to system path

ghcompfolder = gh.Folders.DefaultAssemblyFolder
if ghcompfolder not in sys.path:
    sys.path.append(ghcompfolder)

try:
    from Alpaca4d import alpaca4d as alpaca
except:
    msg = "Cannot import Alpaca4d. Is the Alpaca4d folder available in " + ghcompfolder + "?"
    ghenv.Component.AddRuntimeMessage(gh.Kernel.GH_RuntimeMessageLevel.Error, msg)



FolderPath = rs.DocumentPath()
os.chdir(FolderPath)


# import costum modules to read the hdf5 file

my_module_name = "Alpaca_StepReader"
my_module = sys.modules.setdefault(my_module_name, type(sys)(my_module_name))

hdfFilePath = os.path.join(ghcompfolder, "Alpaca4d\HDF5CSharp.dll")
clr.AddReferenceToFileAndPath(hdfFilePath)

from HDF5CSharp import Hdf5

try:
    Steps = my_module.Steps
except AttributeError:
    type_2d = type(System.Array.CreateInstance(float, 1, 1))

    class Steps(object):
        __metaclass__ = clrtype.ClrClass
        _clrfields = {"STEP_{}".format(i): type_2d for i in range(1000)} # it will work for model with less than 1000 steps

    my_module.Steps = Steps


checkData = True

if not AlpacaModel:
    checkData = False
    msg = "Input parameter AlpacaModel failed to collect data"
    ghenv.Component.AddRuntimeMessage(gh.Kernel.GH_RuntimeMessageLevel.Warning, msg)

History = False if History is None else History

if checkData:
    
    step = (int(AlpacaModel.analysis.NumberOfSteps) - 1) if step is None else step
# read result
    
    p11 = []
    p22 = []
    p12 = []
    
    m11 = []
    m22 = []
    m12 = []
    
    q1 = []
    q2 = []
    
    
    
    ## to fix the issue about index of different type of object
    
    if History == False:
        try:
            fileId = Hdf5.OpenFile(AlpacaModel.recorderName, True)
            
            #asdea shell
            #stressResult = Hdf5.ReadObject[Steps](fileId, "/MODEL_STAGE[1]/RESULTS/ON_ELEMENTS/stresses/203-UnknownMovableObject[201:0:0]/DATA")
            
            #shellMITC4
            stressResult = Hdf5.ReadObject[Steps](fileId, "/MODEL_STAGE[1]/RESULTS/ON_ELEMENTS/stresses/53-UnknownMovableObject[201:0:0]/DATA")
            #stressResult = Hdf5.ReadObject[Steps](fileId, "/MODEL_STAGE[1]/RESULTS/ON_ELEMENTS/stresses/167-UnknownMovableObject[103:0:0]/DATA")
            for i,item in enumerate(AlpacaModel.shells):
                
                p11_0 = getattr(stressResult, 'STEP_{}'.format(step))[i,0]
                p11_1 = getattr(stressResult, 'STEP_{}'.format(step))[i,8]
                p11_2 = getattr(stressResult, 'STEP_{}'.format(step))[i,16]
                p11_3 = getattr(stressResult, 'STEP_{}'.format(step))[i,24]
                
                
                p11.append([p11_0,p11_1,p11_2,p11_3])
                
                
                
                p22_0 = getattr(stressResult, 'STEP_{}'.format(step))[i,1]
                p22_1 = getattr(stressResult, 'STEP_{}'.format(step))[i,9]
                p22_2 = getattr(stressResult, 'STEP_{}'.format(step))[i,17]
                p22_3 = getattr(stressResult, 'STEP_{}'.format(step))[i,25]
                
                p22.append([p22_0,p22_1,p22_2,p22_3])
                
                
                p12_0 = getattr(stressResult, 'STEP_{}'.format(step))[i,2]
                p12_1 = getattr(stressResult, 'STEP_{}'.format(step))[i,10]
                p12_2 = getattr(stressResult, 'STEP_{}'.format(step))[i,18]
                p12_3 = getattr(stressResult, 'STEP_{}'.format(step))[i,26]
                
                p12.append([p12_0,p12_1,p12_2,p12_3])
                
                
                m11_0 = getattr(stressResult, 'STEP_{}'.format(step))[i,3]
                m11_1 = getattr(stressResult, 'STEP_{}'.format(step))[i,11]
                m11_2 = getattr(stressResult, 'STEP_{}'.format(step))[i,19]
                m11_3 = getattr(stressResult, 'STEP_{}'.format(step))[i,27]
                
                m11.append([m11_0,m11_1,m11_2,m11_3])
                
                
                m22_0 = getattr(stressResult, 'STEP_{}'.format(step))[i,4]
                m22_1 = getattr(stressResult, 'STEP_{}'.format(step))[i,12]
                m22_2 = getattr(stressResult, 'STEP_{}'.format(step))[i,20]
                m22_3 = getattr(stressResult, 'STEP_{}'.format(step))[i,28]
                
                m22.append([m22_0,m22_1,m22_2,m22_3])
                
                
                m12_0 = getattr(stressResult, 'STEP_{}'.format(step))[i,5]
                m12_1 = getattr(stressResult, 'STEP_{}'.format(step))[i,13]
                m12_2 = getattr(stressResult, 'STEP_{}'.format(step))[i,21]
                m12_3 = getattr(stressResult, 'STEP_{}'.format(step))[i,29]
                
                m12.append([m12_0,m12_1,m12_2,m12_3])
                
                
                q1_0 = getattr(stressResult, 'STEP_{}'.format(step))[i,6]
                q1_1 = getattr(stressResult, 'STEP_{}'.format(step))[i,14]
                q1_2 = getattr(stressResult, 'STEP_{}'.format(step))[i,22]
                q1_3 = getattr(stressResult, 'STEP_{}'.format(step))[i,30]
                
                q1.append([q1_0,q1_1,q1_2,q1_3])
                
                
                q2_0 = getattr(stressResult, 'STEP_{}'.format(step))[i,7]
                q2_1 = getattr(stressResult, 'STEP_{}'.format(step))[i,15]
                q2_2 = getattr(stressResult, 'STEP_{}'.format(step))[i,23]
                q2_3 = getattr(stressResult, 'STEP_{}'.format(step))[i,31]
                
                q2.append([q2_0,q2_1,q2_2,q2_3])
                
                
                
            Hdf5.CloseFile(fileId)
            print("I have close the file")
        except:
            Hdf5.CloseFile(fileId)
            print("I have close the file")
    
    
    elif History == True:
        try:
            fileId = Hdf5.OpenFile(AlpacaModel.recorderName, True)
        
            maxNumberStep = int(AlpacaModel.analysis.NumberOfSteps)
            
            stressResult = Hdf5.ReadObject[Steps](fileId, "/MODEL_STAGE[1]/RESULTS/ON_ELEMENTS/stresses/53-UnknownMovableObject[201:0:0]/DATA")
            #stressResult = Hdf5.ReadObject[Steps](fileId, "/MODEL_STAGE[1]/RESULTS/ON_ELEMENTS/stresses/167-UnknownMovableObject[103:0:0]/DATA")
            
            
            for i,item in enumerate(AlpacaModel.shells):
                
                p11Temp = []
                p22Temp = []
                p12Temp = []
                
                m11Temp = []
                m22Temp = []
                m12Temp = []
                
                q1Temp = []
                q2Temp = []
                
                
                for n_step in range(maxNumberStep):
                    p11_0 = getattr(stressResult, 'STEP_{}'.format(n_step))[i,0]
                    p11_1 = getattr(stressResult, 'STEP_{}'.format(n_step))[i,8]
                    p11_2 = getattr(stressResult, 'STEP_{}'.format(n_step))[i,16]
                    p11_3 = getattr(stressResult, 'STEP_{}'.format(n_step))[i,24]
                    
                    p11Temp.append([p11_0,p11_1,p11_2,p11_3])
                    
                    
                    
                    p22_0 = getattr(stressResult, 'STEP_{}'.format(n_step))[i,1]
                    p22_1 = getattr(stressResult, 'STEP_{}'.format(n_step))[i,9]
                    p22_2 = getattr(stressResult, 'STEP_{}'.format(n_step))[i,17]
                    p22_3 = getattr(stressResult, 'STEP_{}'.format(n_step))[i,25]
                    
                    p22Temp.append([p22_0,p22_1,p22_2,p22_3])
                    
                    
                    p12_0 = getattr(stressResult, 'STEP_{}'.format(n_step))[i,2]
                    p12_1 = getattr(stressResult, 'STEP_{}'.format(n_step))[i,10]
                    p12_2 = getattr(stressResult, 'STEP_{}'.format(n_step))[i,18]
                    p12_3 = getattr(stressResult, 'STEP_{}'.format(n_step))[i,26]
                    
                    p12Temp.append([p12_0,p12_1,p12_2,p12_3])
                    
                    
                    m11_0 = getattr(stressResult, 'STEP_{}'.format(n_step))[i,3]
                    m11_1 = getattr(stressResult, 'STEP_{}'.format(n_step))[i,11]
                    m11_2 = getattr(stressResult, 'STEP_{}'.format(n_step))[i,19]
                    m11_3 = getattr(stressResult, 'STEP_{}'.format(n_step))[i,27]
                    
                    m11Temp.append([m11_0,m11_1,m11_2,m11_3])
                    
                    
                    m22_0 = getattr(stressResult, 'STEP_{}'.format(n_step))[i,4]
                    m22_1 = getattr(stressResult, 'STEP_{}'.format(n_step))[i,12]
                    m22_2 = getattr(stressResult, 'STEP_{}'.format(n_step))[i,20]
                    m22_3 = getattr(stressResult, 'STEP_{}'.format(n_step))[i,28]
                    
                    m22Temp.append([m22_0,m22_1,m22_2,m22_3])
                    
                    
                    m12_0 = getattr(stressResult, 'STEP_{}'.format(n_step))[i,5]
                    m12_1 = getattr(stressResult, 'STEP_{}'.format(n_step))[i,13]
                    m12_2 = getattr(stressResult, 'STEP_{}'.format(n_step))[i,21]
                    m12_3 = getattr(stressResult, 'STEP_{}'.format(n_step))[i,29]
                    
                    m12Temp.append([m12_0,m12_1,m12_2,m12_3])
                    
                    
                    q1_0 = getattr(stressResult, 'STEP_{}'.format(n_step))[i,6]
                    q1_1 = getattr(stressResult, 'STEP_{}'.format(n_step))[i,14]
                    q1_2 = getattr(stressResult, 'STEP_{}'.format(n_step))[i,22]
                    q1_3 = getattr(stressResult, 'STEP_{}'.format(n_step))[i,30]
                    
                    q1Temp.append([q1_0,q1_1,q1_2,q1_3])
                    
                    
                    q2_0 = getattr(stressResult, 'STEP_{}'.format(n_step))[i,7]
                    q2_1 = getattr(stressResult, 'STEP_{}'.format(n_step))[i,15]
                    q2_2 = getattr(stressResult, 'STEP_{}'.format(n_step))[i,23]
                    q2_3 = getattr(stressResult, 'STEP_{}'.format(n_step))[i,31]
                    
                    q2Temp.append([q2_0,q2_1,q2_2,q2_3])
                
                p11.append(p11Temp)
                p22.append(p22Temp)
                p12.append(p12Temp)
                
                m11.append(m11Temp)
                m22.append(m22Temp)
                m12.append(m12Temp)
                
                q1.append(q1Temp)
                q2.append(q2Temp)
            Hdf5.CloseFile(fileId)
            print("I have close the file")
        except:
            Hdf5.CloseFile(fileId)
            print("I have close the file")
    
    
    
    Mesh = []
    for item in AlpacaModel.shells:
        Mesh.append(item.Mesh)
    
    p11 = th.list_to_tree(p11)
    p22 = th.list_to_tree(p22)
    p12 = th.list_to_tree(p12)
    
    m11 = th.list_to_tree(m11)
    m22 = th.list_to_tree(m22)
    m12 = th.list_to_tree(m12)
    
    q1 = th.list_to_tree(q1)
    q2 = th.list_to_tree(q2)
# ---------- end ss ----------
bf = BeamForcesAlpaca4d()  # -> out, N, M2, T1, M1, T2, Mz; inputs History: Boolean, step: Int32
# ---------- bf: Python ----------
"""
Read Beam Forces

    Args:
        AlpacaModel:
        History:
        step:
    Returns:
        N: forces in direction 3  (Axial Force)
        M2: Moments around axis 2 (Bending Moment 1)
        T1: forces in direction 1 (Shear Force 1)
        M1: Moments around axis 1 (Bending Moment 2)
        T2: forces in direction 2 (Shear Force 2)
        Mt: Moments around axis 3 (Twisting Moment)
"""

import sys
import os
import System
from System.Drawing import Color
import clr
import clrtype
import Rhino.Geometry as rg
import rhinoscriptsyntax as rs
import Grasshopper as gh
import copy
import ghpythonlib.treehelpers as th


ghenv.Component.Name = "Beam Forces (Alpaca4d)"
ghenv.Component.NickName = 'BF'
ghenv.Component.Message = "Beam Forces (Alpaca4d)"
## add alpaca install directory to system path

ghcompfolder = gh.Folders.DefaultAssemblyFolder
if ghcompfolder not in sys.path:
    sys.path.append(ghcompfolder)

try:
    from Alpaca4d import alpaca4d as alpaca
except:
    msg = "Cannot import Alpaca4d. Is the Alpaca4d folder available in " + ghcompfolder + "?"
    ghenv.Component.AddRuntimeMessage(gh.Kernel.GH_RuntimeMessageLevel.Error, msg)



FolderPath = rs.DocumentPath()
os.chdir(FolderPath)


# import costum modules to read the hdf5 file

my_module_name = "Alpaca_StepReader"
my_module = sys.modules.setdefault(my_module_name, type(sys)(my_module_name))

hdfFilePath = os.path.join(ghcompfolder, "Alpaca4d\HDF5CSharp.dll")
clr.AddReferenceToFileAndPath(hdfFilePath)

from HDF5CSharp import Hdf5

try:
    Steps = my_module.Steps
except AttributeError:
    type_2d = type(System.Array.CreateInstance(float, 1, 1))

    class Steps(object):
        __metaclass__ = clrtype.ClrClass
        _clrfields = {"STEP_{}".format(i): type_2d for i in range(1000)} # it will work for model with less than 1000 steps

    my_module.Steps = Steps


checkData = True

if not AlpacaModel:
    checkData = False
    msg = "Input parameter AlpacaModel failed to collect data"
    ghenv.Component.AddRuntimeMessage(gh.Kernel.GH_RuntimeMessageLevel.Warning, msg)

if checkData:
    
    step = (int(AlpacaModel.analysis.NumberOfSteps) - 1) if step is None else step
    
    N = []
    T1 = []
    T2 = []
    M1 = []
    M2 = []
    Mz = []
    
    fileId = Hdf5.OpenFile(AlpacaModel.recorderName, True)
    
    stressResult = Hdf5.ReadObject[Steps](fileId, "/MODEL_STAGE[1]/RESULTS/ON_ELEMENTS/section.force/74-ForceBeamColumn3d[1000:1:0]/DATA")
    if History is True:
        try:
            maxNumberStep = int(AlpacaModel.analysis.NumberOfSteps)
        
        
            for i,item in enumerate(AlpacaModel.beams):
                
                Ni = []
                M2i = []
                T1i = []
                
                M1i = []
                T2i = []
                Mzi = []
                
                for istep in range(maxNumberStep):
                
                    ni = 5 # potrebbe cambiare per ogni trave
                    Ni.append([getattr(stressResult, 'STEP_{}'.format(istep))[i,j] for j in range(0,ni*6, 6)])
                    M2i.append([ getattr(stressResult, 'STEP_{}'.format(istep))[i,j] for j in range(1,ni*6, 6)])
                    T1i.append([ getattr(stressResult, 'STEP_{}'.format(istep))[i,j] for j in range(2,ni*6, 6)])
                    M1i.append([ getattr(stressResult, 'STEP_{}'.format(istep))[i,j] for j in range(3,ni*6, 6)])
                    T2i.append([ getattr(stressResult, 'STEP_{}'.format(istep))[i,j] for j in range(4,ni*6, 6)])
                    Mzi.append([ getattr(stressResult, 'STEP_{}'.format(istep))[i,j] for j in range(5,ni*6, 6)])
                
                N.append([Ni])
                M2.append([M2i])
                T1.append([T1i])
                M1.append([M1i])
                T2.append([T2i])
                Mz.append([Mzi])
            Hdf5.CloseFile(fileId)
            print("I have closed the file")
        except:
            Hdf5.CloseFile(fileId)
            print("I have closed the file")
    elif History == False:
        try:
            for i,item in enumerate(AlpacaModel.beams):
                ni = 5 # potrebbe cambiare per ogni trave
                Ni = [ getattr(stressResult, 'STEP_{}'.format(step))[i,j] for j in range(0,ni*6, 6)]
                M2i = [ getattr(stressResult, 'STEP_{}'.format(step))[i,j] for j in range(1,ni*6, 6)]  
                T1i = [ getattr(stressResult, 'STEP_{}'.format(step))[i,j] for j in range(2,ni*6, 6)]
                M1i = [ getattr(stressResult, 'STEP_{}'.format(step))[i,j] for j in range(3,ni*6, 6)]
                T2i = [ getattr(stressResult, 'STEP_{}'.format(step))[i,j] for j in range(4,ni*6, 6)]
                Mzi = [ getattr(stressResult, 'STEP_{}'.format(step))[i,j] for j in range(5,ni*6, 6)]
                
                N.append([Ni])
                M2.append([M2i])
                T1.append([T1i])
                M1.append([M1i])
                T2.append([T2i])
                Mz.append([Mzi])
            
            Hdf5.CloseFile(fileId)
            print("I have closed the file")
        
        except:
            Hdf5.CloseFile(fileId)
            print("I have closed the file")
    
    
    
    N = th.list_to_tree(N)
    M2 = th.list_to_tree(M2)
    T1 = th.list_to_tree(T1)
    M1 = th.list_to_tree(M1)
    T2 = th.list_to_tree(T2)
    Mz = th.list_to_tree(Mz)
# ---------- end bf ----------
reset = Button()
run = BooleanToggle(False)
python_8 = PythonScript(Run=run, Reset=reset, Interval=Slider(1, range=1..1000), maxValue="500")  # -> Counter; inputs Run: Boolean
# ---------- python_8: Python ----------
import Grasshopper as gh

def updateComponent(interval):
    
    """ Updates this component, similar to using a grasshopper timer """
    
    # Define callback action
    def callBack(e):
        ghenv.Component.ExpireSolution(False)
        
    # Get grasshopper document
    ghDoc = ghenv.Component.OnPingDocument()
    
    # Schedule this component to expire
    ghDoc.ScheduleSolution(interval,gh.Kernel.GH_Document.GH_ScheduleDelegate(callBack)) # Note that the first input here is how often to update the component (in milliseconds)

# Instantiate/reset persisent starting counter variable
if "myCounter" not in globals() or Reset:
    myCounter = 0

# Update the variable and component
if Run and not Reset:
    myCounter +=1
    updateComponent(Interval)
    print(myCounter)
    if myCounter > maxValue:
        myCounter = 0


# Output counter
Counter = myCounter
# ---------- end python_8 ----------
panel_7 = Panel(python_8)
number_slider_3 = Slider(0, range=0..9)
nd = NodalDisplacementsAlpaca4d(AlpacaModel=ra.AlpacaSolvedModel, step=python_8)  # -> out, displacement, rotation; inputs History: Boolean, step: Int32
# ---------- nd: Python ----------
"""
Read displacement results
-
    Args:
        AlpacaModel:
        History: True to visualise the displacement and rotation history of the points
        step:
    Returns:
        displacement:
        rotation:
        displacement_History:
        rotation_History:
"""

ghenv.Component.Name = "Nodal Displacements (Alpaca4d)"
ghenv.Component.NickName = 'ND'
ghenv.Component.Message = "Nodal Displacements\n (Alpaca4d)"

import sys
import os
import System
from System.Drawing import Color


import clr
import clrtype
import Rhino.Geometry as rg
import rhinoscriptsyntax as rs
import Grasshopper as gh
import copy
import ghpythonlib.treehelpers as th



## add alpaca install directory to system path

ghcompfolder = gh.Folders.DefaultAssemblyFolder
if ghcompfolder not in sys.path:
    sys.path.append(ghcompfolder)

try:
    from Alpaca4d import alpaca4d as alpaca
except:
    msg = "Cannot import Alpaca4d. Is the Alpaca4d folder available in " + ghcompfolder + "?"
    ghenv.Component.AddRuntimeMessage(gh.Kernel.GH_RuntimeMessageLevel.Error, msg)



FolderPath = rs.DocumentPath()
os.chdir(FolderPath)

my_module_name = "Alpaca_StepReader" # replace this with something unique that doesn't collide with a real module!
my_module = sys.modules.setdefault(my_module_name, type(sys)(my_module_name))

hdfFilePath = os.path.join(ghcompfolder, "Alpaca4d\HDF5CSharp.dll")
clr.AddReferenceToFileAndPath(hdfFilePath)


from HDF5CSharp import Hdf5

try:
    Steps = my_module.Steps
except AttributeError:
    type_2d = type(System.Array.CreateInstance(float, 1, 1))

    class Steps(object):
        __metaclass__ = clrtype.ClrClass
        _clrfields = {"STEP_{}".format(i): type_2d for i in range(1000)} # it will work for model with less than 1000 steps

    my_module.Steps = Steps



checkData = True

if not AlpacaModel:
    checkData = False
    msg = "Input parameter AlpacaModel failed to collect data"
    ghenv.Component.AddRuntimeMessage(gh.Kernel.GH_RuntimeMessageLevel.Warning, msg)



History = False if History is None else History


if checkData:
    step = (int(AlpacaModel.analysis.NumberOfSteps) - 1) if step is None else step
    numberOfPoints = len(AlpacaModel.uniquePoints) #
    
    if not History:
        try:
            fileId = Hdf5.OpenFile(AlpacaModel.recorderName, True)
            
            
            displacementResult = Hdf5.ReadObject[Steps](fileId, "/MODEL_STAGE[1]/RESULTS/ON_NODES/DISPLACEMENT/DATA")
            displacement = []
            for i in range(numberOfPoints):
                x = getattr(displacementResult, 'STEP_{}'.format(step))[i,0]
                y = getattr(displacementResult, 'STEP_{}'.format(step))[i,1]
                z = getattr(displacementResult, 'STEP_{}'.format(step))[i,2]
                displacement.append(rg.Vector3d(x,y,z))
            
            
            rotationResult = Hdf5.ReadObject[Steps](fileId, "/MODEL_STAGE[1]/RESULTS/ON_NODES/ROTATION/DATA")
            rotation = []
            for i in range(numberOfPoints):
                x = getattr(rotationResult, 'STEP_{}'.format(step))[i,0]
                y = getattr(rotationResult, 'STEP_{}'.format(step))[i,1]
                z = getattr(rotationResult, 'STEP_{}'.format(step))[i,2]
                rotation.append(rg.Vector3d(x,y,z))
                
                
            Hdf5.CloseFile(fileId)
            print("I have closed the file")
        except:
            if fileId >0:
                Hdf5.CloseFile(fileId)
                print("I have closed the file because of exception")
    
    
    
    if History:
        try:
            fileId = Hdf5.OpenFile(AlpacaModel.recorderName, True)
            
            displacementResult = Hdf5.ReadObject[Steps](fileId, "/MODEL_STAGE[1]/RESULTS/ON_NODES/DISPLACEMENT/DATA")
            displacement = []
            
            for i in range(numberOfPoints):
                dispTemp = []
                maxNumberStep = int(AlpacaModel.analysis.NumberOfSteps)
                for n_step in range(maxNumberStep):
                    x = getattr(displacementResult, 'STEP_{}'.format(n_step))[i,0]
                    y = getattr(displacementResult, 'STEP_{}'.format(n_step))[i,1]
                    z = getattr(displacementResult, 'STEP_{}'.format(n_step))[i,2]
                    dispTemp.append(rg.Vector3d(x,y,z))
                    
                
                displacement.append(dispTemp)
    
    
    
    
            rotationResult = Hdf5.ReadObject[Steps](fileId, "/MODEL_STAGE[1]/RESULTS/ON_NODES/ROTATION/DATA")
            
            rotation = []
            
            for i in range(numberOfPoints):
                rotationTemp = []
                for n_step in range(maxNumberStep):
                    x = getattr(rotationResult, 'STEP_{}'.format(n_step))[i,0]
                    y = getattr(rotationResult, 'STEP_{}'.format(n_step))[i,1]
                    z = getattr(rotationResult, 'STEP_{}'.format(n_step))[i,2]
                    rotationTemp.append(rg.Vector3d(x,y,z))
                
                rotation.append(rotationTemp)
                
            Hdf5.CloseFile(fileId)
        except:
            Hdf5.CloseFile(fileId)
    
    
    displacement = th.list_to_tree(displacement)
    rotation = th.list_to_tree(rotation)
# ---------- end nd ----------
number_slider_4 = Slider(0, range=0..1)
python_9 = GhPythonScript(x=ra.AlpacaSolvedModel)  # -> out, a
# ---------- python_9: Python ----------
a = x.uniquePoints
# ---------- end python_9 ----------
clean = CombineClean(Meshes=mesh_2)
multiplication = Multiplication(A=nd.displacement, B=Slider(0, range=0..0.0001))
toggle_3 = BooleanToggle(True)  # disabled
move = Move(Geometry=python_9.a, Motion=multiplication)  # -> Geometry, Transform
data_3 = Data(ra.AlpacaSolvedModel)  # disabled
panel_8 = Panel(nd.displacement)
rf = ReactionForcesAlpaca4d(AlpacaModel=data_3)  # -> out, SupportPosition, ReactionForce, ReactionMoment; inputs History: Boolean, step: Int32; disabled
# ---------- rf: Python ----------
"""
Read Reaction Forces
    Args:
        AlpacaModel:
        History:
        step:
    Returns:
        SupportPosition:
        ReactionForce:
        ReactionMoment:
        ReactionForce_History:
        ReactionMoment_History:
"""

ghenv.Component.Name = "Reaction Forces (Alpaca4d)"
ghenv.Component.NickName = 'RF'
ghenv.Component.Message = 'Reaction Forces\n (Alpaca4d)'


import sys
import os
import System
from System.Drawing import Color


import clr
import clrtype
import Rhino.Geometry as rg
import rhinoscriptsyntax as rs
import Grasshopper as gh
import copy
import ghpythonlib.treehelpers as th



## add alpaca install directory to system path

ghcompfolder = gh.Folders.DefaultAssemblyFolder
if ghcompfolder not in sys.path:
    sys.path.append(ghcompfolder)

try:
    from Alpaca4d import alpaca4d as alpaca
except:
    msg = "Cannot import Alpaca4d. Is the Alpaca4d folder available in " + ghcompfolder + "?"
    ghenv.Component.AddRuntimeMessage(gh.Kernel.GH_RuntimeMessageLevel.Error, msg)



FolderPath = rs.DocumentPath()
os.chdir(FolderPath)

my_module_name = "Alpaca_StepReader" # replace this with something unique that doesn't collide with a real module!
my_module = sys.modules.setdefault(my_module_name, type(sys)(my_module_name))

hdfFilePath = os.path.join(ghcompfolder, "Alpaca4d\HDF5CSharp.dll")
clr.AddReferenceToFileAndPath(hdfFilePath)


from HDF5CSharp import Hdf5

try:
    Steps = my_module.Steps
except AttributeError:
    type_2d = type(System.Array.CreateInstance(float, 1, 1))

    class Steps(object):
        __metaclass__ = clrtype.ClrClass
        _clrfields = {"STEP_{}".format(i): type_2d for i in range(1000)} # it will work for model with less than 1000 steps

    my_module.Steps = Steps



checkData = True

if not AlpacaModel:
    checkData = False
    msg = "Input parameter AlpacaModel failed to collect data"
    ghenv.Component.AddRuntimeMessage(gh.Kernel.GH_RuntimeMessageLevel.Warning, msg)



History = False if History is None else History


if checkData:
    step = (int(AlpacaModel.analysis.NumberOfSteps) - 1) if step is None else step
    supportTagLocation = [item.nodeTag - 1 for item in AlpacaModel.supports] #
    
    if not History:
    
        try:
            fileId = Hdf5.OpenFile(AlpacaModel.recorderName, True)
            
            
            reactionForceResult = Hdf5.ReadObject[Steps](fileId, "/MODEL_STAGE[1]/RESULTS/ON_NODES/REACTION_FORCE/DATA")
            ReactionForce = []
            for i in supportTagLocation:
                x = getattr(reactionForceResult, 'STEP_{}'.format(step))[i,0]
                y = getattr(reactionForceResult, 'STEP_{}'.format(step))[i,1]
                z = getattr(reactionForceResult, 'STEP_{}'.format(step))[i,2]
                ReactionForce.append(rg.Vector3d(x,y,z))
            
            
            ReactionMomentResult = Hdf5.ReadObject[Steps](fileId, "/MODEL_STAGE[1]/RESULTS/ON_NODES/REACTION_MOMENT/DATA")
            ReactionMoment = []
            for i in supportTagLocation:
                x = getattr(ReactionMomentResult, 'STEP_{}'.format(step))[i,0]
                y = getattr(ReactionMomentResult, 'STEP_{}'.format(step))[i,1]
                z = getattr(ReactionMomentResult, 'STEP_{}'.format(step))[i,2]
                ReactionMoment.append(rg.Vector3d(x,y,z))
                
            Hdf5.CloseFile(fileId)
            
        except:
            if fileId >0:
                Hdf5.CloseFile(fileId)
                print("I have closed the file")
    
    
    if History:
        try:
            fileId = Hdf5.OpenFile(AlpacaModel.recorderName, True)
        
            maxNumberStep = int(AlpacaModel.analysis.NumberOfSteps)
            
            reactionForceResult = Hdf5.ReadObject[Steps](fileId, "/MODEL_STAGE[1]/RESULTS/ON_NODES/REACTION_FORCE/DATA")
            ReactionForce = []
            for i in supportTagLocation:
                reactionForceTemp = []
                for n_step in range(maxNumberStep):
                    x = getattr(reactionForceResult, 'STEP_{}'.format(n_step))[i,0]
                    y = getattr(reactionForceResult, 'STEP_{}'.format(n_step))[i,1]
                    z = getattr(reactionForceResult, 'STEP_{}'.format(n_step))[i,2]
                    reactionForceTemp.append(rg.Vector3d(x,y,z))
            
                ReactionForce.append(reactionForceTemp)
    
    
            reactionMomentResult = Hdf5.ReadObject[Steps](fileId, "/MODEL_STAGE[1]/RESULTS/ON_NODES/REACTION_MOMENT/DATA")
            ReactionMoment = []
            for i in supportTagLocation:
                reactionMomentTemp = []
                for n_step in range(maxNumberStep):
                    x = getattr(reactionMomentResult, 'STEP_{}'.format(n_step))[i,0]
                    y = getattr(reactionMomentResult, 'STEP_{}'.format(n_step))[i,1]
                    z = getattr(reactionMomentResult, 'STEP_{}'.format(n_step))[i,2]
                    reactionMomentTemp.append(rg.Vector3d(x,y,z))
            
                ReactionMoment.append(reactionMomentTemp)
            Hdf5.CloseFile(fileId)
            
        except:
            Hdf5.CloseFile(fileId)
    
    
    
    
    SupportPosition = [item.Pos for item in AlpacaModel.supports]
    ReactionForce = th.list_to_tree(ReactionForce)
    ReactionMoment = th.list_to_tree(ReactionMoment)
# ---------- end rf ----------

panel_9 = Panel("10")  # disabled
panel_10 = Panel("21000")  # disabled
panel_11 = Panel("0.3")  # disabled
panel_12 = Panel("8070")  # disabled
panel_13 = Panel("0.3")  # disabled
panel_14 = Panel("21000")  # disabled
panel_15 = Panel("8070")  # disabled
panel_16 = Panel("500")  # disabled
python_10 = GhPythonScript(
    Ex=panel_10,
    Ey=panel_10,
    Ez=panel_10,
    vxy=panel_11,
    vyz=panel_11,
    vzx=panel_11,
    Gxy=panel_12,
    Gyz=panel_12,
    Gzy=panel_12,
    rho=panel_9)  # -> out, nDMaterial; disabled
# ---------- python_10: Python ----------
import opensees.openseesGH as alpaca


nDMaterial = alpaca.ElasticOrthotropic(name, Ex,Ey,Ez,vxy,vyz,vzx,Gxy,Gyz,Gzy,rho,fy)




print(nDMaterial.write_tcl())
# ---------- end python_10 ----------
python_11 = GhPythonScript(
    Ex=panel_14,
    Ey=panel_14,
    Ez=panel_14,
    vxy=panel_13,
    vyz=panel_13,
    vzx=panel_13,
    Gxy=panel_15,
    Gyz=panel_15,
    Gzy=panel_15,
    rho=panel_16)  # -> out, nDMaterial; disabled
# ---------- python_11: Python ----------
import opensees.openseesGH as alpaca


nDMaterial = alpaca.ElasticOrthotropic(name, Ex,Ey,Ez,vxy,vyz,vzx,Gxy,Gyz,Gzy,rho,fy)

print(nDMaterial.rho)
print(nDMaterial.vxy)

print(nDMaterial.write_tcl())
# ---------- end python_11 ----------
merge = Merge(Data1=python_10.nDMaterial, Data2=python_11.nDMaterial, Data3=python_10.nDMaterial)  # disabled
panel_17 = Panel("""10
10
10""")  # disabled
panel_18 = Panel("CLT")  # disabled
python_12 = GhPythonScript(sectionName=panel_18, materials=merge, thicknesses=panel_17)  # -> out, layeredShellSection; inputs materials: list, thicknesses: list; disabled
# ---------- python_12: Python ----------
import opensees.openseesGH as alpaca

#layeredShellSection = alpaca.LayeredShell(sectionName, materials, thicknesses)
#layeredShellSectionPY = alpaca.LayeredShell(sectionName, materials, thicknesses).write_py()

layeredShellSection = alpaca.LayeredShell(sectionName, materials, thicknesses)
# ---------- end python_12 ----------

graft = GraftTree(Tree=rf.SupportPosition, IncludeEmptyLists=True, IncludeNullItems=True)  # disabled
number_slider_5 = Slider(3.51, range=1..5)  # disabled
panel_19 = Panel("5")  # disabled
swatch_5 = ColourSwatch(SwatchColor=RGB(232, 0, 0))  # disabled
division = Division(A=rf.ReactionForce, B=panel_19)  # disabled
multiplication_2 = Multiplication(A=division, B=number_slider_5)  # disabled

split = SplitTree(Masks=flatten("{<30}"))  # -> Positive, Negative
data_4 = Data(split.Positive)
graph = QuickGraph(data_4, SortOrder=0)

vdisex = VectorDisplayEx(Point=graft, Vector=multiplication_2, Colour=swatch_5, Width=2)  # disabled

# ----
# Layered Shell
python_13 = GhPythonScript()  # -> out, LayeredShell; inputs thicknesses: list, nDMaterials: list; disabled
# ---------- python_13: Python ----------
"""
Create a support
-
    Args:
        secName:
        thicknesses:
        nDMaterials:
    Returns:
        fiberSection:
"""


import sys
import Rhino.Geometry as rg
import Grasshopper as gh
import copy


## add alpaca install directory to system path

ghcompfolder = gh.Folders.DefaultAssemblyFolder
if ghcompfolder not in sys.path:
    sys.path.append(ghcompfolder)

try:
    from Alpaca4d import alpaca4d as alpaca
except:
    msg = "Cannot import Alpaca4d. Is the Alpaca4d folder available in " + ghcompfolder + "?"
    ghenv.Component.AddRuntimeMessage(gh.Kernel.GH_RuntimeMessageLevel.Error, msg)


checkData = True

if not thicknesses:
    checkData = False
    msg = "Input parameter thicknesses failed to collect data"
    ghenv.Component.AddRuntimeMessage(gh.Kernel.GH_RuntimeMessageLevel.Warning, msg)

if not nDMaterials:
    checkData = False
    msg = "Input parameter nDMaterials failed to collect data"
    ghenv.Component.AddRuntimeMessage(gh.Kernel.GH_RuntimeMessageLevel.Warning, msg)

if checkData:
    LayeredShell = alpaca.LayeredShell(secName, nDMaterials, thicknesses)
# ---------- end python_13 ----------

# ----
# ForceBeamColumn
python_14 = GhPythonScript()  # -> out, element; inputs Line: Curve, Colour: Color; disabled
# ---------- python_14: Python ----------
"""
Create a support
-
    Args:
        Line:
        CrossSection:
        Colour:
        Orient:
    Returns:
        element:
"""


import sys
import Rhino.Geometry as rg
import Grasshopper as gh
import copy


## add alpaca install directory to system path

ghcompfolder = gh.Folders.DefaultAssemblyFolder
if ghcompfolder not in sys.path:
    sys.path.append(ghcompfolder)

try:
    from Alpaca4d import alpaca4d as alpaca
except:
    msg = "Cannot import Alpaca4d. Is the Alpaca4d folder available in " + ghcompfolder + "?"
    ghenv.Component.AddRuntimeMessage(gh.Kernel.GH_RuntimeMessageLevel.Error, msg)


checkData = True

if not Line:
    checkData = False
    msg = "Input parameter Line failed to collect data"
    ghenv.Component.AddRuntimeMessage(gh.Kernel.GH_RuntimeMessageLevel.Warning, msg)


if not CrossSection:
    checkData = False
    msg = "Input parameter CrossSection failed to collect data"
    ghenv.Component.AddRuntimeMessage(gh.Kernel.GH_RuntimeMessageLevel.Warning, msg)

if not Colour:
    Colour = Color.Red

if not Orient:
    Orient = 0.0


if checkData:
    newCrossSection = copy.deepcopy(CrossSection)
    element = alpaca.ForceBeamColumn(Line, newCrossSection, Colour, Orient)
# ---------- end python_14 ----------

# ----
# equalDOF
python_15 = GhPythonScript()  # -> out, Constraint; inputs masterNode: Point3d, slaveNode: Point3d, dof_x: Boolean, dof_y: Boolean, dof_z: Boolean, dof_xx: Boolean, dof_yy: Boolean, dof_zz: Boolean; disabled
# ---------- python_15: Python ----------
"""
Create a support
-
    Args:
        masterNode:
        slaveNodes:
    Returns:
        RigidDiaphragm:
"""


import sys
import Rhino.Geometry as rg
import Grasshopper as gh
import copy
from System.Drawing import Color


## add alpaca install directory to system path

ghcompfolder = gh.Folders.DefaultAssemblyFolder
if ghcompfolder not in sys.path:
    sys.path.append(ghcompfolder)

try:
    from Alpaca4d import alpaca4d as alpaca
except:
    msg = "Cannot import Alpaca4d. Is the Alpaca4d folder available in " + ghcompfolder + "?"
    ghenv.Component.AddRuntimeMessage(gh.Kernel.GH_RuntimeMessageLevel.Error, msg)


checkData = True

if not masterNode:
    checkData = False
    msg = "Input parameter masterNode failed to collect data"
    ghenv.Component.AddRuntimeMessage(gh.Kernel.GH_RuntimeMessageLevel.Warning, msg)

if not slaveNode:
    checkData = False
    msg = "Input parameter masterNode failed to collect data"
    ghenv.Component.AddRuntimeMessage(gh.Kernel.GH_RuntimeMessageLevel.Warning, msg)

if not dof_x or dof_y or dof_z or dof_xx or dof_yy or dof_zz:
    dof_x = True
    dof_y = True
    dof_z = True
    dof_xx = True
    dof_yy = True
    dof_zz = True

if checkData:
    Constraint = alpaca.EqualDOF(masterNode, slaveNode, dof_x, dof_y, dof_z, dof_xx, dof_yy, dof_zz)
# ---------- end python_15 ----------

# ----
# Trigonometric Time Series
tts = TrigonometricTimeSeriesAlpaca4d(tStart=Slider(0, range=0..5), tEnd="10.00", period="3.00")  # -> timeSeries, Graph
# ---------- tts: Python ----------
"""
Create a Trigonometric Time Series
-
    Args:
        tStart:
        tEnd:
        period:
        factor:
        shift:
    Returns:
        timeSeries:
        Graph:
"""

ghenv.Component.Name = "Trigonometric Time Series (Alpaca4d)"
ghenv.Component.NickName = 'TTS'
ghenv.Component.Message = "Trigonometric Time Series\n (Alpaca4d)"


import sys
import Rhino.Geometry as rg
import Grasshopper as gh
import copy
import math


## add alpaca install directory to system path

ghcompfolder = gh.Folders.DefaultAssemblyFolder
if ghcompfolder not in sys.path:
    sys.path.append(ghcompfolder)

try:
    from Alpaca4d import alpaca4d as alpaca
except:
    msg = "Cannot import Alpaca4d. Is the Alpaca4d folder available in " + ghcompfolder + "?"
    ghenv.Component.AddRuntimeMessage(gh.Kernel.GH_RuntimeMessageLevel.Error, msg)


def TrigonometricSeries(tStart, tEnd, period, shift, factor,t):
    if tStart <= t and t < tEnd:
        x = factor * math.sin( (2.0 * math.pi * (t - tStart))/period + shift)
        return x
    else:
        return 0

def linspace(a, b, n):
    if n < 2:
        return None
    diff = (float(b) - a)/(n - 1)
    return [diff * i + a  for i in range(n)]



checkData = True

if not tStart and not tStart == 0:
    checkData = False
    msg = "Input parameter tStart failed to collect data"
    ghenv.Component.AddRuntimeMessage(gh.Kernel.GH_RuntimeMessageLevel.Warning, msg)

if not tEnd and not tEnd == 0:
    checkData = False
    msg = "Input parameter tEnd failed to collect data"
    ghenv.Component.AddRuntimeMessage(gh.Kernel.GH_RuntimeMessageLevel.Warning, msg)

if not period:
    checkData = False
    msg = "Input parameter period failed to collect data"
    ghenv.Component.AddRuntimeMessage(gh.Kernel.GH_RuntimeMessageLevel.Warning, msg)

if not factor:
    factor = 1

if not shift:
    shift = 0

if checkData:
    timeSeries = alpaca.TimeSeriesTrigonometric(tStart, tEnd, period, factor, shift)

    Graph = []
    
    for t in linspace(0,tEnd*2,100):
        Graph.append(TrigonometricSeries(tStart, tEnd, period, shift, factor,t))
# ---------- end tts ----------
panel_20 = Panel(tts.timeSeries)

graph_2 = QuickGraph(tts.Graph, SortOrder=0)

num = Number([-0.000450671, -0.000455154, -1.48413e-05, 0.000507632, 0.000437923, 0.000441503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])
lng = ListLength(List=num)
series = Series(Start=0, Step="0.01", Count=lng)

# ----
# Path TimeSeries
number_slider_6 = Slider(7, range=1..10)
pts = PathTimeSeriesAlpaca4d(time=series, values=num, factor=number_slider_6)  # -> out, timeSeries, Graph; inputs time: list, values: list
# ---------- pts: Python ----------
"""
Create a Time Series Path
-
    Args:
        time:
        values:
        factor:
    Returns:
        timeSeries:
        Graph:
"""

ghenv.Component.Name = "Path Time Series (Alpaca4d)"
ghenv.Component.NickName = 'PTS'
ghenv.Component.Message = "Path Time Series\n (Alpaca4d)"


import sys
import Rhino.Geometry as rg
import Grasshopper as gh
import copy


## add alpaca install directory to system path

ghcompfolder = gh.Folders.DefaultAssemblyFolder
if ghcompfolder not in sys.path:
    sys.path.append(ghcompfolder)

try:
    from Alpaca4d import alpaca4d as alpaca
except:
    msg = "Cannot import Alpaca4d. Is the Alpaca4d folder available in " + ghcompfolder + "?"
    ghenv.Component.AddRuntimeMessage(gh.Kernel.GH_RuntimeMessageLevel.Error, msg)


checkData = True

if not time:
    checkData = False
    msg = "Input parameter time failed to collect data"
    ghenv.Component.AddRuntimeMessage(gh.Kernel.GH_RuntimeMessageLevel.Warning, msg)

if not values:
    checkData = False
    msg = "Input parameter values failed to collect data"
    ghenv.Component.AddRuntimeMessage(gh.Kernel.GH_RuntimeMessageLevel.Warning, msg)

if not factor:
    factor = 1


if checkData:
    timeSeries = alpaca.TimeSeriesPath(values, time, factor)
    Graph = [value * factor for value in values]
# ---------- end pts ----------

graph_3 = QuickGraph(pts.Graph, SortOrder=0)

save_picture = BooleanToggle(True)
select_palette = Slider(1, range=0..6)
picture_name = Panel("test")
panel_21 = Panel("""2
4
6
4
3
3
6""")
swatch_6 = ColourSwatch(SwatchColor=RGB(255, 255, 255))
swatch_7 = ColourSwatch(SwatchColor=RGB(0, 0, 0))
item_4 = ListItem(List=panel_21, Index=select_palette, Wrap=True)
merge_2 = Merge(Data1=swatch_6, Data2=swatch_7, Data3=swatch_6, Data4=swatch_7, Data5=swatch_6, Data6=swatch_6, Data7=swatch_6)
merge_3 = Merge(
    Data1=ColourSwatch(SwatchColor=RGB(0, 0, 0)),
    Data2=ColourSwatch(SwatchColor=RGB(148, 0, 181)),
    Data3=ColourSwatch(SwatchColor=RGB(255, 170, 0)),
    Data4=ColourSwatch(SwatchColor=RGB(194, 194, 14)),
    Data5=ColourSwatch(SwatchColor=RGB(34, 58, 212)),
    Data6=ColourSwatch(SwatchColor=RGB(48, 159, 255)),
    Data7=ColourSwatch(SwatchColor=RGB(237, 12, 42)))
gradientlibrary = GradientLibrary(gradIndex=item_4)  # -> colors; inputs gradIndex: Int32
#   port colors: A series of colors to be plugged into the "Ladybug_Legend Parameters" component.
# ---------- gradientlibrary: Python ----------
"""
Preset of gradient colors perfect for Data Visualisation
    Inputs:
        gradIndex: An index refering to one of the following possible gradients:
            0 - Orignal Ladybug
            1 - Nuanced Ladybug
            2 - Multi-colored Ladybug
            3 - Ecotect
            4 - Thermal Comfort Percentage
            5 - Thermal Comfort Colors
            6 - Shade Benefit/Harm
            7 - Shade Harm
            8 - Shade Benefit
            9 - CFD Colors 1
            10 - Radiation Benefit
            11 - Gsa10 Colour
            12 - Gsa9 Colour
    Returns:
        customColors: A series of colors.
"""

ghenv.Component.Name = "Gradient Library"
ghenv.Component.NickName = 'GradientLibrary'
#ghenv.Component.Message = 'GradientLibrary\nWIP'

import scriptcontext as sc
import Grasshopper.Kernel as gh
import System

gradientLibrary = {
        0: [System.Drawing.Color.FromArgb(75, 107, 169), System.Drawing.Color.FromArgb(115, 147, 202), System.Drawing.Color.FromArgb(170, 200, 247), System.Drawing.Color.FromArgb(193, 213, 208), System.Drawing.Color.FromArgb(245, 239, 103), System.Drawing.Color.FromArgb(252, 230, 74), System.Drawing.Color.FromArgb(239, 156, 21), System.Drawing.Color.FromArgb(234, 123, 0), System.Drawing.Color.FromArgb(234, 74, 0), System.Drawing.Color.FromArgb(234, 38, 0)],
        1: [System.Drawing.Color.FromArgb(49,54,149), System.Drawing.Color.FromArgb(69,117,180), System.Drawing.Color.FromArgb(116,173,209), System.Drawing.Color.FromArgb(171,217,233), System.Drawing.Color.FromArgb(224,243,248), System.Drawing.Color.FromArgb(255,255,191), System.Drawing.Color.FromArgb(254,224,144), System.Drawing.Color.FromArgb(253,174,97), System.Drawing.Color.FromArgb(244,109,67), System.Drawing.Color.FromArgb(215,48,39), System.Drawing.Color.FromArgb(165,0,38)],
        2: [System.Drawing.Color.FromArgb(4,25,145), System.Drawing.Color.FromArgb(7,48,224), System.Drawing.Color.FromArgb(7,88,255), System.Drawing.Color.FromArgb(1,232,255), System.Drawing.Color.FromArgb(97,246,156), System.Drawing.Color.FromArgb(166,249,86), System.Drawing.Color.FromArgb(254,244,1), System.Drawing.Color.FromArgb(255,121,0), System.Drawing.Color.FromArgb(239,39,0), System.Drawing.Color.FromArgb(138,17,0)],
        3: [System.Drawing.Color.FromArgb(0,0,255), System.Drawing.Color.FromArgb(53,0,202), System.Drawing.Color.FromArgb(107,0,148), System.Drawing.Color.FromArgb(160,0,95), System.Drawing.Color.FromArgb(214,0,41), System.Drawing.Color.FromArgb(255,12,0), System.Drawing.Color.FromArgb(255,66,0), System.Drawing.Color.FromArgb(255,119,0), System.Drawing.Color.FromArgb(255,173,0), System.Drawing.Color.FromArgb(255,226,0), System.Drawing.Color.FromArgb(255,255,0)],
        4: [System.Drawing.Color.FromArgb(0,0,0), System.Drawing.Color.FromArgb(110,0,153), System.Drawing.Color.FromArgb(255,0,0), System.Drawing.Color.FromArgb(255,255,102), System.Drawing.Color.FromArgb(255,255,255)],
        5: [System.Drawing.Color.FromArgb(0,136,255), System.Drawing.Color.FromArgb(200,225,255), System.Drawing.Color.FromArgb(255,255,255), System.Drawing.Color.FromArgb(255,230,230), System.Drawing.Color.FromArgb(255,0,0)],
        6: [System.Drawing.Color.FromArgb(5,48,97), System.Drawing.Color.FromArgb(33,102,172), System.Drawing.Color.FromArgb(67,147,195), System.Drawing.Color.FromArgb(146,197,222), System.Drawing.Color.FromArgb(209,229,240), System.Drawing.Color.FromArgb(255,255,255), System.Drawing.Color.FromArgb(253,219,199), System.Drawing.Color.FromArgb(244,165,130), System.Drawing.Color.FromArgb(214,96,77), System.Drawing.Color.FromArgb(178,24,43), System.Drawing.Color.FromArgb(103,0,31)],
        7: [System.Drawing.Color.FromArgb(255,255,255), System.Drawing.Color.FromArgb(253,219,199), System.Drawing.Color.FromArgb(244,165,130), System.Drawing.Color.FromArgb(214,96,77), System.Drawing.Color.FromArgb(178,24,43), System.Drawing.Color.FromArgb(103,0,31)],
        8: [System.Drawing.Color.FromArgb(255,255,255), System.Drawing.Color.FromArgb(209,229,240), System.Drawing.Color.FromArgb(146,197,222), System.Drawing.Color.FromArgb(67,147,195), System.Drawing.Color.FromArgb(33,102,172), System.Drawing.Color.FromArgb(5,48,97)],
        9: [System.Drawing.Color.FromArgb(0,16,120), System.Drawing.Color.FromArgb(38,70,160), System.Drawing.Color.FromArgb(5,180,222), System.Drawing.Color.FromArgb(16,180,109), System.Drawing.Color.FromArgb(59,183,35), System.Drawing.Color.FromArgb(143,209,19), System.Drawing.Color.FromArgb(228,215,29), System.Drawing.Color.FromArgb(246,147,17), System.Drawing.Color.FromArgb(243,74,0), System.Drawing.Color.FromArgb(255,0,0)],
        10: [System.Drawing.Color.FromArgb(0,191,48), System.Drawing.Color.FromArgb(255,238,184), System.Drawing.Color.FromArgb(255,0,0)],
        11: [System.Drawing.Color.FromArgb(204,0,71), System.Drawing.Color.FromArgb(255,182,71), System.Drawing.Color.FromArgb(206,255,115), System.Drawing.Color.FromArgb(26,180, 214),System.Drawing.Color.FromArgb(0,0,207)],
        12: [System.Drawing.Color.FromArgb(255, 51, 51), System.Drawing.Color.FromArgb(255, 170, 51), System.Drawing.Color.FromArgb(255, 255, 51), System.Drawing.Color.FromArgb(170, 255, 125), System.Drawing.Color.FromArgb(51, 255, 231), System.Drawing.Color.FromArgb(51, 170, 255), System.Drawing.Color.FromArgb(51,51, 255)]}
colors = gradientLibrary[gradIndex]
# ---------- end gradientlibrary ----------
item_5 = ListItem(List=merge_3, Index=select_palette, Wrap=True)
col = Colour(gradientlibrary)
item_6 = ListItem(List=merge_2, Index=select_palette, Wrap=True)
python_16 = GhPythonScript(color=item_5)  # -> out; inputs color: Color
# ---------- python_16: Python ----------
import Rhino.ApplicationSettings.AppearanceSettings
import System
import scriptcontext

settings = Rhino.ApplicationSettings.AppearanceSettings
settings.ViewportBackgroundColor = color

scriptcontext.doc.Views.Redraw()
# ---------- end python_16 ----------
viewports = ViewportProperties(Update=update, AutoUpdate=False)  # -> ViewportNames, ActiveViewportIndex, ViewportBounds, ViewportDisplayMode, CameraLocation, CameraTarget, CameraPlane, CameraLensLength, CameraProjection, CameraUp
item_7 = ListItem(List=viewports.ViewportBounds, Index=viewports.ActiveViewportIndex, Wrap=True)
drec = DeconstuctRectangle(Rectangle=item_7)  # -> BasePlane, XInterval, YInterval
number_slider_7 = Slider(35, range=1..70)
int = Integer(expr("x/2", drec.XInterval))
int_2 = Integer(expr("x*0.9", drec.YInterval))
number_slider_8 = Slider(16, range=1..50)
random = Random(Range="0 to 3.5", Number="200", Seed=2)
multiplication_3 = Multiplication(A=number_slider_8, B=0.5)
num_2 = Number(expr("Round(x,0)", random))
bnd = Bounds(Numbers=num_2)
dedomain = DeconstructDomain(Domain=bnd)  # -> Start, End
merge_4 = Merge(Data1=dedomain.Start, Data2=dedomain.End)
int_3 = Integer(drec.YInterval)
int_4 = Integer(drec.XInterval)
captureview = Ladybug_CaptureView(fileName=picture_name, imageWidth=int_4, imageHeight=int_3, capture=save_picture)  # -> Output; plug-in component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
panel_22 = Panel(captureview)
python_17 = GhPythonScript(imagePath=captureview)  # -> out, a
# ---------- python_17: Python ----------
import System


fileName =r'C:\Dev\WorkWithImage\cutImage.py'
pythonInterpreter = 'python.exe'

wrapperFile = '"' + imagePath + '"'
fileName = '"' + fileName + '"'

p = System.Diagnostics.Process()
p.StartInfo.RedirectStandardOutput = True
p.StartInfo.RedirectStandardError = True

p.StartInfo.UseShellExecute = False
p.StartInfo.CreateNoWindow = True

p.StartInfo.FileName = pythonInterpreter
p.StartInfo.Arguments = fileName + " " + wrapperFile + " " 
p.Start()
p.WaitForExit()

a = p.StandardOutput.ReadLine()
# ---------- end python_17 ----------
panel_23 = Panel(python_17.a)

# ----
# CHOOSE
# YOUR COLOUR
panel_24 = Panel("9")
range = Range(Domain=Domain(0, 1), Steps=panel_24)
twnthrucols = TweenThroughColors(Colors=col, Factor=range, Normalized=True, Equalized=False, Weighted=False, Degree=3, InterpolationType=0, Alpha=True)

# ----
# Legend Panel
panel_25 = Panel("10")
rectangle = Rectangle(Plane=PlaneXY(0, 0, 0), XSize="0.5", YSize=panel_25, Radius=0)  # -> Rectangle, Length
rectangle_2 = Rectangle(Plane=PlaneXY(0, 0, 0), XSize=panel_25, YSize="0.5", Radius=0)  # -> Rectangle, Length
boundary = BoundarySurfaces(Edges=rectangle_2.Rectangle)
divide_2 = DivideDomain(Domain=boundary, UCount="1", VCount=10)
divide_3 = DivideDomain(Domain=boundary, UCount=10, VCount="1")
subsrf = Isotrim(Surface=boundary, Domain=divide_3)
explode_4 = MeshExplode(Mesh=subsrf, Interpolate=False)
mcol = MeshColours(Mesh=explode_4, Colours=graft(twnthrucols))  # -> flatten(Mesh)
mjoin_3 = MeshJoin(Meshes=mcol)
weldvertices_2 = MeshWeldVertices(Mesh=mjoin_3, Tolerance=0.01)  # -> RuntimeMessage, Mesh
pt_7 = ConstructPoint(XCoordinate=int, YCoordinate=int_2, ZCoordinate=0)

multiplication_4 = Multiplication(A=number_slider_7, B=panel_25)
division_2 = Division(A=multiplication_4, B="2")
X_2 = UnitX(Factor=division_2)
rev = Reverse(Vector=X_2)
move_2 = Move(Geometry=pt_7, Motion=rev)  # -> Geometry, Transform
multiplication_5 = Multiplication(A=number_slider_7, B=panel_25)
multiplication_6 = Multiplication(A="0.5", B=number_slider_7)
X_3 = UnitX(Factor=multiplication_5)
move_3 = Move(Geometry=move_2.Geometry, Motion=X_3)  # -> Geometry, Transform
addition = Addition(A=multiplication_6, B=multiplication_3)
merge_5 = Merge(Data1=move_2.Geometry, Data2=move_3.Geometry)
vec_2 = VectorXYZ(XComponent=0, YComponent=addition, ZComponent=0)  # -> Vector, Length
move_4 = Move(Geometry=merge_5, Motion=vec_2.Vector)  # -> Geometry, Transform
texttoscreen = RenderTextToScreen(Text=merge_4, Location=move_4.Geometry, Size=number_slider_8, Color=item_6, Font="Iosevka", m_scWithvp=False)

meshtoscreen = RenderMeshToScreen(
    Mesh=weldvertices_2.Mesh,
    Location=move_2.Geometry,
    ScaleFactor=number_slider_7,
    Depth=0.95,
    Fixed=True,
    m_scWithvp=False)

demesh_2 = DeconstructMesh(Mesh=clean)  # -> Vertices, Faces, Colours, Normals
number_slider_9 = Slider(1, range=1..100)
panel_26 = Panel("0.03")
gradientlibrary_2 = GradientLibrary(gradIndex=Slider(6, range=1..12))  # -> colors; inputs gradIndex: Int32; same code as gradientlibrary

cp = ClosestPoint(Point=demesh_2.Vertices, Cloud=python_9.a)  # -> ClosestPoint, CPIndex, Distance
item_8 = ListItem(List=nd.displacement, Index=cp.CPIndex, Wrap=True)

devec = DeconstructVector(Vector=item_8)  # -> XComponent, YComponent, ZComponent
vlen = VectorLength(Vector=item_8)
multiplication_7 = Multiplication(A=item_8, B="0.0001")
bnd_2 = Bounds(Numbers=vlen)
remap = RemapNumbers(Value=vlen, Source=bnd_2, Target="0.05 to 0.90")  # -> Mapped, Clipped
move_5 = Move(Geometry=demesh_2.Vertices, Motion=multiplication_7)  # -> Geometry, Transform
twnthrucols_2 = TweenThroughColors(
    Colors=gradientlibrary,
    Factor=remap.Mapped,
    Normalized=True,
    Equalized=False,
    Weighted=False,
    Degree=3,
    InterpolationType=0,
    Alpha=True)
conmesh = ConstructMesh(Vertices=move_5.Geometry, Faces=demesh_2.Faces, Colours=twnthrucols_2)

mjoin_4 = MeshJoin(Meshes=conmesh)
weldvertices_3 = MeshWeldVertices(Mesh=mjoin_4, Tolerance=0.01)  # -> RuntimeMessage, Mesh
clean_2 = CombineClean(Meshes=weldvertices_3.Mesh)
wbnaked_3 = WeaverbirdsNakedBoundary(MeshClosedPolylines=clean_2)
previewlw_3 = CustomPreviewLineweights(Geometry=wbnaked_3, Shader=ColourSwatch(SwatchColor=RGB(0, 0, 0)), Thickness=Slider(4, range=1..5), Absolute=False)
