# Grasshopper definition visualizeThickerLinesAndVector.gh (Grasshopper 1.0.7)

crv = Curve(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)
series = Series(Start=0, Step=1, Count=10)
Z = UnitZ(Factor=series)
move = Move(Geometry=crv, Motion=Z)  # -> Geometry, Transform
lng = ListLength(List=move.Geometry)
random = Random(Range=Domain(0, 1), Number=lng, Seed=2)
hsv = ColourHSV(Alpha=1, Hue=random, Saturation=1, Value=1)
crv_2 = Curve(move.Geometry)
col = Colour(hsv)
python = GhPythonScript(Visualise=Toggle(False), Crv=crv_2, Color=col, Weight=Slider(3, range=0..10))  # inputs Visualise: Boolean, Crv: list, Color: list
# ---------- python: Python ----------
import Rhino as rc
from scriptcontext import sticky as st


if True:
    for k,v in st.items():
        if type(v) is rc.Display.CustomDisplay:
            v.Dispose()
            del st[k]
ghenv.Component.ExpireSolution(True)


def customDisplay(toggle,component):
    
    """ Make a custom display that is unique to the component and lives in sticky """
    
    # Make unique name and custom display
    displayGuid = "customDisplay_" + str(component.InstanceGuid)
    if displayGuid not in st:
        st[displayGuid] = rc.Display.CustomDisplay(True)
        
    # Clear display each time component runs
    st[displayGuid].Clear()
    
    # Return the display or get rid of it
    if toggle:
        return st[displayGuid]
    else:
        st[displayGuid].Dispose()
        del st[displayGuid]
        return None

cd = customDisplay(True,ghenv.Component)


if Visualise and not ghenv.Component.Hidden:
    for crv,color in zip(Crv,Color):
        cd.AddCurve(crv,color,Weight)
# ---------- end python ----------
