# Grasshopper definition inflate_Alpaca3d_Model.gh (Grasshopper 1.0.7)
# plug-ins: MeshEdit Components, Human, LunchBoxML, Dodo, Kangaroo2 Components

mesh = Mesh([<mesh referenced from the Rhino model> x200])
mjoin = MeshJoin(Meshes=mesh)
weldvertices = MeshWeldVertices(Mesh=mjoin, Tolerance=0.01)  # -> RuntimeMessage, Mesh
unifynormals = MeshUnifyNormals(Mesh=weldvertices.Mesh)
mesh_2 = Mesh(unifynormals)
medges = MeshEdges(Mesh=mesh_2)  # -> NakedEdges, InteriorEdges, NonManifoldEdges
crv = Curve(medges.NakedEdges)
crv_2 = Curve(medges.InteriorEdges)
explode = Explode(Curve=crv, Recursive=True)  # -> Segments, flatten(Vertices)
length_line = LengthLine(Line=crv_2, Strength=10)
show = Show(G=crv)
show_2 = Show(G=crv_2)
show_3 = Show(G=mesh_2)
anchor = Anchor(Point=explode.Vertices, Strength=10000)
pressure = Pressure(M=mesh_2, Strength=1)
entwine = Entwine(
    Branch00=show,
    Branch01=show_2,
    Branch02=show_3,
    Branch03=anchor,
    Branch04=length_line,
    Branch05=pressure,
    FlattenInputs=True)
button = Button()
toggle = BooleanToggle(False)
zombiesolver = ZombieSolver(GoalObjects=entwine, Threshold=1e-10, Tolerance=0.01, MaxIterations=50000)  # -> I, V, O
unflatten = UnflattenTree(Tree=zombiesolver.O, Guide=entwine)
bang = ExplodeTree(Data=unflatten)  # -> Branch0, Branch1, Branch2, Branch3, Branch4, Branch5
explode_2 = Explode(Curve=crv, Recursive=True)  # -> Segments, flatten(Vertices)
crv_3 = Curve(bang.Branch0)
geo = Geometry(bang.Branch2)
plfit = PlaneFit(Points=explode_2.Vertices)  # -> Plane, Deviation
mirror = Mirror(Geometry=geo, Plane=plfit.Plane)  # -> Geometry, Transform
merge = Merge(Data1=geo, Data2=mirror.Geometry)
weldvertices_2 = MeshWeldVertices(Mesh=merge, Tolerance=0.01)  # -> RuntimeMessage, Mesh
clean = CombineClean(Meshes=weldvertices_2.Mesh)
mesh_3 = Mesh(clean)
medges_2 = MeshEdges(Mesh=clean)  # -> NakedEdges, InteriorEdges, NonManifoldEdges
explode_3 = MeshExplode(Mesh=mesh_3, Interpolate=False)
area = MeshArea(Mesh=explode_3)  # -> Area, Centroid
devec = DeconstructVector(Vector=area.Centroid)  # -> XComponent, YComponent, ZComponent
merge_2 = Merge(
    Data1=ColourSwatch(SwatchColor=RGB(0, 30, 255)),
    Data2=ColourSwatch(SwatchColor=RGB(67, 136, 247)),
    Data3=ColourSwatch(SwatchColor=RGB(176, 201, 48)),
    Data4=ColourSwatch(SwatchColor=RGB(156, 52, 217)),
    Data5=ColourSwatch(SwatchColor=RGB(235, 109, 63)),
    Data6=ColourSwatch(SwatchColor=RGB(255, 0, 0)))
entwine_2 = Entwine(Branch00=devec.XComponent, Branch01=devec.YComponent, Branch02=devec.ZComponent, FlattenInputs=True)
previewlw = CustomPreviewLineweights(Geometry=medges_2.NakedEdges, Shader=ColourSwatch(SwatchColor=RGB(0, 0, 0)), Thickness="3", Absolute=False)
previewlw_2 = CustomPreviewLineweights(Geometry=medges_2.InteriorEdges, Shader=ColourSwatch(SwatchColor=RGB(0, 0, 0)), Thickness="1", Absolute=False)
lng = ListLength(List=merge_2)
flip = FlipMatrix(Data=entwine_2)
k_means = KMeansClustering(TrainingInputs=flip, OfClusters=lng, RandomSeed=5)  # -> Result, Likelihood, Centroids
groupnums = GroupNumbers(Number=k_means.Result)  # -> Keys, Indices
item = ListItem(List=explode_3, Index=groupnums.Indices, Wrap=True)
graft = GraftTree(Tree=merge_2, IncludeEmptyLists=True, IncludeNullItems=True)
mcol = MeshColours(Mesh=item, Colours=graft)  # -> flatten(Mesh)
mjoin_2 = MeshJoin(Meshes=mcol)
