# Grasshopper definition AlpacaLogo.gh (Grasshopper 1.0.7)
# plug-ins: MeshEdit Components, treesloth01, Human, Weaverbird

# ---- group: palette Perù
merge = Merge(
    Data1=ColourSwatch(SwatchColor=RGB(255, 0, 0)),
    Data2=ColourSwatch(SwatchColor=RGB(235, 109, 63)),
    Data3=ColourSwatch(SwatchColor=RGB(158, 53, 219)),
    Data4=ColourSwatch(SwatchColor=RGB(174, 202, 48)),
    Data5=ColourSwatch(SwatchColor=RGB(67, 136, 247)),
    Data6=ColourSwatch(SwatchColor=RGB(0, 30, 255)))  # -> reverse(Result)

# ----
# 64 x 64 icon
geo = Geometry([<brep referenced from the Rhino model> x45])
geo_2 = Geometry([<brep referenced from the Rhino model> x117])
join = BrepJoin(Breps=flatten(geo_2))  # -> Breps, Closed
join_2 = BrepJoin(Breps=flatten(geo))  # -> Breps, Closed
edges = BrepEdges(Brep=join.Breps)  # -> Naked, Interior, NonManifold
edges_2 = BrepEdges(Brep=join_2.Breps)  # -> Naked, Interior, NonManifold
crv = Curve([edges.Naked, edges.Interior])
crv_2 = Curve(edges_2.Naked)
previewlw = CustomPreviewLineweights(Geometry=crv, Shader=ColourSwatch(SwatchColor=RGB(255, 255, 255)), Thickness=Slider(1, range=1..5), Absolute=False)
previewlw_2 = CustomPreviewLineweights(Geometry=crv_2, Shader=ColourSwatch(SwatchColor=RGB(255, 255, 255)), Thickness=Slider(1, range=1..5), Absolute=False)

number_slider = Slider(1, range=1..5)
number_slider_2 = Slider(4, range=1..5)
crv_3 = Curve([<curve referenced from the Rhino model> x246])
crv_4 = Curve([<curve referenced from the Rhino model> x75])
previewlw_3 = CustomPreviewLineweights(Geometry=crv_3, Shader=ColourSwatch(SwatchColor=RGB(0, 0, 0)), Thickness="2", Absolute=False)
previewlw_4 = CustomPreviewLineweights(Geometry=crv_4, Shader=ColourSwatch(SwatchColor=RGB(0, 0, 0)), Thickness="8", Absolute=False)

geo_3 = Geometry([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])
number_slider_3 = Slider(20, range=0..30)
number_slider_4 = Slider(21, range=0..100)
smesh = SimpleMesh(Brep=geo_3)
area = MeshArea(Mesh=smesh)  # -> Area, Centroid
bnd = Bounds(Numbers=area.Area)
dom = ConstructDomain(DomainStart=number_slider_3, DomainEnd=number_slider_3)
remap = RemapNumbers(Value=area.Area, Source=bnd, Target=dom)  # -> Mapped, Clipped
weaverbird_s_picture_frame = WeaverbirdsPictureFrame(MeshPolylines=flatten(smesh), Distance=remap.Mapped, InsetType=0)
area_2 = MeshArea(Mesh=weaverbird_s_picture_frame)  # -> Area, Centroid
vlen = VectorLength(Vector=area_2.Centroid)
bnd_2 = Bounds(Numbers=flatten(vlen))
lng = ListLength(List=merge)
remap_2 = RemapNumbers(Value=vlen, Source=bnd_2, Target=Domain(0, 1))  # -> Mapped, Clipped
panel = Panel("5")
div = DivideDomain(Domain=Domain(0, 1), Count=lng)
fdom = FindDomain(Domains=div, Number=remap_2.Mapped, Strict=False)  # -> Index, Neighbour
item = ListItem(List=merge, Index=fdom.Index, Wrap=True)
mesh_colours = MeshColours(Mesh=weaverbird_s_picture_frame, Colours=item)
mjoin = MeshJoin(Meshes=flatten(mesh_colours))
weldvertices = MeshWeldVertices(Mesh=mjoin, Tolerance=0.01)  # -> RuntimeMessage, Mesh
mesh = Mesh(weldvertices.Mesh)

geo_4 = Geometry([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])
debrep = DeconstructBrep(Brep=geo_4)  # -> Faces, Edges, Vertices
number_slider_5 = Slider(1, range=0..1)
smesh_2 = SimpleMesh(Brep=geo_4)
graft = GraftTree(Tree=smesh_2, IncludeEmptyLists=True, IncludeNullItems=True)
area_3 = MeshArea(Mesh=graft)  # -> Area, Centroid
vlen_2 = VectorLength(Vector=area_3.Centroid)
bnd_3 = Bounds(Numbers=flatten(vlen_2))
lng_2 = ListLength(List=merge)
remap_3 = RemapNumbers(Value=vlen_2, Source=bnd_3, Target=Domain(0, 1))  # -> Mapped, Clipped
div_2 = DivideDomain(Domain=Domain(0, 1), Count=lng_2)
fdom_2 = FindDomain(Domains=div_2, Number=remap_3.Mapped, Strict=False)  # -> Index, Neighbour
item_2 = ListItem(List=merge, Index=fdom_2.Index, Wrap=True)
mesh_colours_2 = MeshColours(Mesh=graft, Colours=item_2)
mjoin_2 = MeshJoin(Meshes=flatten(mesh_colours_2))
weldvertices_2 = MeshWeldVertices(Mesh=mjoin_2, Tolerance=0.01)  # -> RuntimeMessage, Mesh
mesh_2 = Mesh(weldvertices_2.Mesh)

geo_5 = Geometry([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])
geo_6 = Geometry([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])
debrep_2 = DeconstructBrep(Brep=geo_5)  # -> Faces, Edges, Vertices
debrep_3 = DeconstructBrep(Brep=geo_6)  # -> Faces, Edges, Vertices
number_slider_6 = Slider(1, range=0..1)
number_slider_7 = Slider(20, range=0..30)
number_slider_8 = Slider(21, range=0..100)
smesh_3 = SimpleMesh(Brep=geo_5)
area_4 = MeshArea(Mesh=smesh_3)  # -> Area, Centroid
bnd_4 = Bounds(Numbers=area_4.Area)
dom_2 = ConstructDomain(DomainStart=number_slider_7, DomainEnd=number_slider_7)
remap_4 = RemapNumbers(Value=area_4.Area, Source=bnd_4, Target=dom_2)  # -> Mapped, Clipped
graft_2 = GraftTree(Tree=smesh_3, IncludeEmptyLists=True, IncludeNullItems=True)
area_5 = MeshArea(Mesh=graft_2)  # -> Area, Centroid
vlen_3 = VectorLength(Vector=area_5.Centroid)
bnd_5 = Bounds(Numbers=flatten(vlen_3))
lng_3 = ListLength(List=merge)
remap_5 = RemapNumbers(Value=vlen_3, Source=bnd_5, Target=Domain(0, 1))  # -> Mapped, Clipped
div_3 = DivideDomain(Domain=Domain(0, 1), Count=lng_3)
fdom_3 = FindDomain(Domains=div_3, Number=remap_5.Mapped, Strict=False)  # -> Index, Neighbour
item_3 = ListItem(List=merge, Index=fdom_3.Index, Wrap=True)
mesh_colours_3 = MeshColours(Mesh=graft_2, Colours=item_3)
mesh_3 = Mesh(mesh_colours_3)

geo_7 = Geometry([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])
number_slider_9 = Slider(20, range=0..30)
number_slider_10 = Slider(21, range=0..100)
smesh_4 = SimpleMesh(Brep=geo_7)
area_6 = MeshArea(Mesh=smesh_4)  # -> Area, Centroid
bnd_6 = Bounds(Numbers=area_6.Area)
dom_3 = ConstructDomain(DomainStart=number_slider_9, DomainEnd=number_slider_9)
remap_6 = RemapNumbers(Value=area_6.Area, Source=bnd_6, Target=dom_3)  # -> Mapped, Clipped
weaverbird_s_picture_frame_2 = WeaverbirdsPictureFrame(MeshPolylines=flatten(smesh_4), Distance=remap_6.Mapped, InsetType=0)
area_7 = MeshArea(Mesh=weaverbird_s_picture_frame_2)  # -> Area, Centroid
vlen_4 = VectorLength(Vector=area_7.Centroid)
bnd_7 = Bounds(Numbers=flatten(vlen_4))
lng_4 = ListLength(List=merge)
remap_7 = RemapNumbers(Value=vlen_4, Source=bnd_7, Target=Domain(0, 1))  # -> Mapped, Clipped
div_4 = DivideDomain(Domain=Domain(0, 1), Count=lng_4)
fdom_4 = FindDomain(Domains=div_4, Number=remap_7.Mapped, Strict=False)  # -> Index, Neighbour
item_4 = ListItem(List=merge, Index=fdom_4.Index, Wrap=True)
mesh_colours_4 = MeshColours(Mesh=weaverbird_s_picture_frame_2, Colours=item_4)
mesh_4 = Mesh(mesh_colours_4)

# ---- group: palette Perù
merge_2 = Merge(
    Data1=ColourSwatch(SwatchColor=RGB(209, 17, 17)),
    Data2=ColourSwatch(SwatchColor=RGB(235, 109, 63)),
    Data3=ColourSwatch(SwatchColor=RGB(158, 53, 219)),
    Data4=ColourSwatch(SwatchColor=RGB(173, 227, 48)),
    Data5=ColourSwatch(SwatchColor=RGB(67, 136, 247)),
    Data6=ColourSwatch(SwatchColor=RGB(0, 30, 255)))  # -> reverse(Result)

# ----
geo_8 = Geometry([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])
# Format Engineers CAD Information Issue Disclaimer
# 
# Project: PROJECT NAME
# 
# You should use this model for reference purposes only to assist in co-ordinating your work and is supplementary to formally issued drawings. Once the data is introduced into your own CAD or other system Format Engineers Ltd. can take no responsibility for its accuracy.
# 
# The last set of formally issued paper drawings are the contractual documents which represent the current stage of design development. If you have any queries, please contact the project CAD co-ordinator or the CAD Development Team.
# 
# Changes:
# 
# YYYY-MM-DD: Summary of changes
# 
# Usage notes:
# 
# This definition includes a basic implementation of Merbarki's Farthest Point Seeding algorithm (2005), adapted for tracing lines of principal curvature on NURBS surfaces. Requires modified Triangle.NET, if this isn't attached then... good luck! There are currently two main limitations: (a) this implementation measures density in parameter space, and (b) it doesn't include the dynamic refinement of density that Mebarki suggests.
geo_9 = Geometry([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])
panel_5 = Panel("""13
22
24
26""")
debrep_4 = DeconstructBrep(Brep=geo_9)  # -> Faces, Edges, Vertices
debrep_5 = DeconstructBrep(Brep=geo_8)  # -> Faces, Edges, Vertices
list_item = ListItem(List=geo_8, Index=flatten(panel_5), Wrap=True)
number_slider_11 = Slider(1, range=0..1)
crv_5 = Curve(debrep_4.Edges)
crv_6 = Curve(debrep_5.Edges)
previewlw_5 = CustomPreviewLineweights(Geometry=crv_6, Shader=ColourSwatch(SwatchColor=RGB(0, 0, 0)), Thickness=Slider(1, range=1..5), Absolute=False)
previewlw_6 = CustomPreviewLineweights(Geometry=list_item, Shader=ColourSwatch(SwatchColor=RGB(0, 0, 0)), Thickness=Slider(1, range=1..5), Absolute=False)
previewlw_7 = CustomPreviewLineweights(Geometry=crv_5, Shader=ColourSwatch(SwatchColor=RGB(0, 0, 0)), Thickness=Slider(1, range=1..5), Absolute=False)
number_slider_12 = Slider(10, range=0..100)
join_curves = JoinCurves(Curves=debrep_4.Edges, Preserve=False)
weaverbird_s_mesh_window = WeaverbirdsMeshWindow(MeshPolylines=flatten(join_curves), Distance=number_slider_12, InsetType=0)
weaverbird_s_picture_frame_3 = WeaverbirdsPictureFrame(MeshPolylines=flatten(join_curves), Distance=number_slider_12, InsetType=0)
deconstruct_mesh = DeconstructMesh(Mesh=weaverbird_s_picture_frame_3)  # -> Vertices, Faces, Colours, Normals
deconstruct = Deconstruct(Point=deconstruct_mesh.Vertices)  # -> XComponent, YComponent, ZComponent
stream_filter = StreamFilter(Gate=0, Stream0=deconstruct.XComponent, Stream1=deconstruct.YComponent, Stream2=deconstruct.ZComponent)
bounds = Bounds(Numbers=stream_filter)
deconstruct_domain = DeconstructDomain(Domain=bounds)  # -> Start, End
division = Division(A=stream_filter, B=deconstruct_domain.End)
gradient = Gradient(
    LowerLimit=deconstruct_domain.Start,
    UpperLimit=deconstruct_domain.End,
    Parameter=stream_filter,
    stops=[0: RGB(243, 57, 0), 0.1: RGB(236, 27, 60), 0.2: RGB(210, 0, 118), 0.3: RGB(103, 0, 120), 0.4: RGB(39, 72, 161), 0.5: RGB(1, 192, 229), 0.6: RGB(18, 178, 90), 0.7: RGB(79, 186, 8), 0.8: RGB(220, 237, 32), 0.9: RGB(247, 159, 20), 1: RGB(243, 57, 0)])
interpolate_data = InterpolateData(Data=merge_2, Parameter=stream_filter, Interpolation=2)
mesh_colours_5 = MeshColours(Mesh=weaverbird_s_picture_frame_3, Colours=gradient)
previewlw_8 = CustomPreviewLineweights(
    Geometry=weaverbird_s_mesh_window,
    Shader=ColourSwatch(SwatchColor=RGB(0, 0, 0)),
    Thickness=Slider(1, range=1..5),
    Absolute=False)

crv_7 = Curve(debrep_2.Edges)
crv_8 = Curve(debrep_3.Edges)
crv_9 = Curve(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)
previewlw_9 = CustomPreviewLineweights(Geometry=crv_8, Shader=ColourSwatch(SwatchColor=RGB(0, 0, 0)), Thickness=Slider(1, range=1..5), Absolute=False)
previewlw_10 = CustomPreviewLineweights(Geometry=crv_7, Shader=ColourSwatch(SwatchColor=RGB(0, 0, 0)), Thickness=Slider(1, range=1..5), Absolute=False)
previewlw_11 = CustomPreviewLineweights(Geometry=crv_9, Shader=ColourSwatch(SwatchColor=RGB(0, 0, 0)), Thickness=Slider(5, range=1..5), Absolute=False)

entwine = Entwine(Branch00=crv_7, Branch01=crv_8, Branch02=crv_9, FlattenInputs=True)
entwine_2 = Entwine(Branch00=mesh_3, Branch01=mesh_2, Branch02=mesh_4, Branch03=mesh, FlattenInputs=True)
number_slider_13 = Slider(100, range=1..100)
series = Series(Start=0, Step=number_slider_13, Count="4")
series_2 = Series(Start=0, Step=number_slider_13, Count="4")
X = UnitX(Factor=series)  # -> graft(UnitVector)
X_2 = UnitX(Factor=series_2)  # -> graft(UnitVector)
move = Move(Geometry=graft(entwine), Motion=flatten(X))  # -> Geometry, Transform
flip_last = FlipLast(Data=move.Geometry)  # -> simplify(Data)
move_2 = Move(Geometry=entwine_2, Motion=X_2)  # -> Geometry, Transform
number_slider_14 = Slider(5, range=1..5)
panel_6 = Panel("""1
1
5""")
shift = ShiftPaths(Data=flip_last, Offset=-1)
graft_3 = GraftTree(Tree=panel_6, IncludeEmptyLists=True, IncludeNullItems=True)
unflatten = UnflattenTree()
previewlw_12 = CustomPreviewLineweights(Geometry=shift, Shader=ColourSwatch(SwatchColor=RGB(0, 0, 0)), Thickness=graft_3, Absolute=False)
