# Grasshopper definition cover.gh (Grasshopper 1.0.7)

rectangle = Rectangle(Plane=PlaneXY(0, 0, 0), XSize="1174", YSize="435", Radius=0)  # -> Rectangle, Length
boundary = BoundarySurfaces(Edges=rectangle.Rectangle)
divide = DivideDomain²(Domain=boundary, UCount=Slider(8, range=1..8), VCount=Slider(1, range=1..8))
subsrf = Isotrim(Surface=boundary, Domain=divide)
