# Grasshopper definition 00_Multi_Storey_Building_Static.gh (Grasshopper 1.0.7)
# plug-ins: Kangaroo2 Components, Weaverbird, MeshEdit Components, EleFront, treesloth01

number_floor = Slider(5, range=2..15)
series = Series(Start=0, Step="5", Count=number_floor)
rectangle = Rectangle(Plane=PlaneXY(0, 0, 0), XSize="40", YSize="20", Radius=0)  # -> Rectangle, Length
Z = UnitZ(Factor=series)
srf = Surface(simplify(rectangle.Rectangle))
span_v = Slider(5, range=1..6)
span_u = Slider(5, range=1..6)

# ---- group: Element
data = Data(0)
data_2 = Data(0)

# ---- group: Load
# Static Analyses
# Units
# N, m
data_3 = Data(0)
data_4 = Data(0)

# ----
num = Number("40")
num_2 = Number("20")

# ---- group: Cross_Section
data_5 = Data(0)
data_6 = Data(0)

# ---- group: Support
data_7 = Data(0)
data_8 = Data(0)

# ----
division = Division(A=num, B=span_u)
division_2 = Division(A=num_2, B=span_v)

# ---- group: Material
data_9 = Data(0)
data_10 = Data(0)

# ---- group: Constraint
data_11 = Data(0)
data_12 = Data(0)

# ----
mplane = MeshPlane(Boundary=rectangle.Rectangle, WidthCount=division, HeightCount=division_2)  # -> Mesh, Area

# ---- group: Visualization
data_13 = Data(0)
data_14 = Data(0)

# ---- group: Output
data_15 = Data(0)
data_16 = Data(0)

# ----
medges = MeshEdges(Mesh=mplane.Mesh)  # -> NakedEdges, InteriorEdges, NonManifoldEdges
nv = NakedVertices(Mesh=mplane.Mesh)  # -> ClothedIndex, NakedIndex, ClothedPts, NakedPts
join = JoinCurves(Curves=medges.NakedEdges, Preserve=False)
explode = Explode(Curve=join, Recursive=True)  # -> Segments, Vertices
graft = GraftTree(Tree=nv.ClothedPts, IncludeEmptyLists=True, IncludeNullItems=True)
graft_2 = GraftTree(Tree=nv.NakedPts, IncludeEmptyLists=True, IncludeNullItems=True)
graft_3 = GraftTree(Tree=explode.Segments, IncludeEmptyLists=True, IncludeNullItems=True)
graft_4 = GraftTree(Tree=medges.InteriorEdges, IncludeEmptyLists=True, IncludeNullItems=True)
vec = Vector(Z)
vec_2 = Vector(Z)
vec_3 = Vector(Z)
vec_4 = Vector(Z)

panel = Panel("""10
22""")
faceb = FaceBoundaries(Mesh=mplane.Mesh)
item = ListItem(List=faceb, Index=panel, Wrap=True)
graft_5 = GraftTree(Tree=item, IncludeEmptyLists=True, IncludeNullItems=True)
vec_5 = Vector(Z)
move = Move(Geometry=graft_5, Motion=vec_5)  # -> Geometry, Transform
shift = ShiftList(List=move.Geometry, Shift=1, Wrap=invert(True))
merge = Merge(Data1=simplify(graft(move.Geometry)), Data2=simplify(graft(shift)))
loft = Loft(Curves=merge, Options={Adjust=False, Closed=False, LoftEnds=0, LoftSimp=0, LoftType=0, Rebuild=10, Refit=0.01})
clean = CleanTree(RemoveNulls=True, RemoveInvalid=True, RemoveEmpty=invert(False), Tree=loft)
debrep = DeconstructBrep(Brep=clean)  # -> simplify(Faces), Edges, Vertices

pcen = PolygonCenter(Polyline=faceb)  # -> CenterV, CenterE, CenterA
move_2 = Move(Geometry=graft, Motion=vec_2)  # -> Geometry, Transform
move_3 = Move(Geometry=graft_2, Motion=vec_3)  # -> Geometry, Transform
move_4 = Move(Geometry=graft_3, Motion=vec_4)  # -> Geometry, Transform
move_5 = Move(Geometry=graft_4, Motion=vec)  # -> Geometry, Transform
lng = ListLength(List=pcen.CenterV)
crv = Curve(simplify(move_4.Geometry))
pline = PolyLine(Vertices=move_2.Geometry, Closed=False)
pline_2 = PolyLine(Vertices=move_3.Geometry, Closed=False)
crv_2 = Curve(simplify(move_5.Geometry))
series_2 = Series(Start=0, Step=1, Count=lng)
flip = FlipMatrix(Data=crv)
flip_2 = FlipMatrix(Data=crv_2)
textdot = DefineTextDot(Text=series_2, Location=pcen.CenterV, Font="Arial", Size=14)
join_2 = JoinCurves(Curves=flip_2, Preserve=invert(False))
join_3 = JoinCurves(Curves=flip, Preserve=False)
split = SplitTree(Data=simplify(join_3), Masks=flatten("{>0}"))  # -> Positive, Negative
split_2 = SplitTree(Data=simplify(join_2), Masks=flatten("{>0}"))  # -> Positive, Negative
external_colum = Curve(pline_2)
internal_colum = Curve(pline)
internal_beam = Curve(split_2.Positive)
outer_beam = Curve(split.Positive)
crv_3 = Curve(crv)

branch = TreeBranch(Tree=crv_3, Path=[Slider(3, range=0..17), Slider(16, range=0..17)], MaintainPaths=True)
crv_4 = Curve(branch)
shift_2 = ShiftList(List=crv_4, Shift=1, Wrap=invert(True))
merge_2 = Merge(Data1=simplify(graft(crv_4)), Data2=simplify(graft(shift_2)))
loft_2 = Loft(Curves=merge_2, Options={Adjust=False, Closed=False, LoftEnds=0, LoftSimp=0, LoftType=0, Rebuild=10, Refit=0.01})
clean_2 = CleanTree(RemoveNulls=True, RemoveInvalid=True, RemoveEmpty=invert(False), Tree=loft_2)
debrep_2 = DeconstructBrep(Brep=clean_2)  # -> simplify(Faces), Edges, Vertices
item_2 = ListItem(List=debrep_2.Vertices, Index=0, Wrap=True)  # -> Item, Item1, Item2, Item3
ln = Line(StartPoint=item_2.Item, EndPoint=item_2.Item2)
ln_2 = Line(StartPoint=item_2.Item1, EndPoint=item_2.Item3)

flip_3 = FlipMatrix(Data=crv_3)

graft_6 = GraftTree(Tree=debrep.Faces, IncludeEmptyLists=True, IncludeNullItems=True)
dim = Dimensions(Surface=graft_6)  # -> UDimension, VDimension
num_3 = Number(dim.UDimension)
num_4 = Number(dim.VDimension)
division_3 = Division(A=num_3, B=Slider(1, range=0.1..1))
division_4 = Division(A=num_4, B=Slider(1, range=0.1..1))
divide = DivideDomain²(Domain=graft_6, UCount=division_3, VCount=division_4)
subsrf = Isotrim(Surface=graft_6, Domain=divide)  # -> simplify(Surface)
smesh = SimpleMesh(Brep=subsrf)  # -> simplify(Mesh)

branch_2 = TreeBranch(Tree=flip_3, Path="0", MaintainPaths=True)
crv_5 = Curve(branch_2)
explode_2 = Explode(Curve=crv_5, Recursive=True)  # -> Segments, Vertices
shift_3 = ShiftPaths(Data=simplify(explode_2.Segments), Offset=-1)
midpt = CurveMiddle(Curve=shift_3)
lng_2 = ListLength(List=midpt)
series_3 = Series(Start=0, Step=1, Count=lng_2)
textdot_2 = DefineTextDot(Text=series_3, Location=midpt, Font="Arial", Size=14)

mjoin = MeshJoin(Meshes=flatten(smesh))
weldvertices = MeshWeldVertices(Mesh=mjoin, Tolerance=0.01)  # -> RuntimeMessage, Mesh

merge_3 = Merge(Data1=ln, Data2=ln_2)

# ----
# Connect if you want to use the mesh element
wbnaked = WeaverbirdsNakedBoundary(MeshClosedPolylines=weldvertices.Mesh)
item_3 = ListItem(List=wbnaked, Index=0, Wrap=True)
explode_3 = Explode(Curve=item_3, Recursive=True)  # -> Segments, Vertices
geo = Geometry([nv.ClothedPts, nv.NakedPts])
merge_4 = Merge(Data1=geo)  # -> flatten(Result)
cullpt = CullDuplicates(Points=merge_4, Tolerance=0.1, CullMode=3)  # -> Points, Indices, Valence

eim = ElasticIsotropicMaterialAlpaca4d(E="33000000000", v="0.20", rho="2500")  # -> out, nDMaterial
# ---------- eim: Python ----------
"""
Create a nD Elastic Isotropic Material
-
    Args:
        name:
        E:
        G:
        v:
        rho:
    Returns:
        nDMaterial:
"""

ghenv.Component.Name = "Elastic Isotropic Material (Alpaca4d)"
ghenv.Component.NickName = 'EIM'
ghenv.Component.Message = "Elastic Isotropic (Alpaca4d)"


import sys
import Rhino.Geometry as rg
import Grasshopper as gh
import copy


## add alpaca install directory to system path

ghcompfolder = gh.Folders.DefaultAssemblyFolder
if ghcompfolder not in sys.path:
    sys.path.append(ghcompfolder)

try:
    from Alpaca4d import alpaca4d as alpaca
except:
    msg = "Cannot import Alpaca4d. Is the Alpaca4d folder available in " + ghcompfolder + "?"
    ghenv.Component.AddRuntimeMessage(gh.Kernel.GH_RuntimeMessageLevel.Error, msg)


checkData = True

if not E:
    checkData = False
    msg = "Input parameter E failed to collect data"
    ghenv.Component.AddRuntimeMessage(gh.Kernel.GH_RuntimeMessageLevel.Warning, msg)

if not G and not v:
    checkData = False
    msg = "Input parameter G or v failed to collect data"
    ghenv.Component.AddRuntimeMessage(gh.Kernel.GH_RuntimeMessageLevel.Warning, msg)

if not rho:
    checkData = False
    msg = "Input parameter rho failed to collect data"
    ghenv.Component.AddRuntimeMessage(gh.Kernel.GH_RuntimeMessageLevel.Warning, msg)

if checkData:
    nDMaterial = alpaca.ElasticIsotropic(name, E, G, rho, v)
# ---------- end eim ----------

mesh = Mesh(weldvertices.Mesh)

uem = UniaxialElasticMaterialAlpaca4d(E="3.3e+10", G="0.20", rho="2500")  # -> out, uniAxialMaterial
# ---------- uem: Python ----------
"""
Create a uniaxial Elastic Material
-
    Args:
        E:
        Eneg:
        eta:
        G:
        v:
        rho:
    Returns:
        uniAxialMaterial:
"""

ghenv.Component.Name = "uniaxial Elastic Material (Alpaca4d)"
ghenv.Component.NickName = 'UEM'
ghenv.Component.Message = "uniaxial Elastic (Alpaca4d)"

import sys
import Rhino.Geometry as rg
import Grasshopper as gh
import copy


## add alpaca install directory to system path

ghcompfolder = gh.Folders.DefaultAssemblyFolder
if ghcompfolder not in sys.path:
    sys.path.append(ghcompfolder)

try:
    from Alpaca4d import alpaca4d as alpaca
except:
    msg = "Cannot import Alpaca4d. Is the Alpaca4d folder available in " + ghcompfolder + "?"
    ghenv.Component.AddRuntimeMessage(gh.Kernel.GH_RuntimeMessageLevel.Error, msg)


checkData = True

if not E:
    checkData = False
    msg = "Input parameter E failed to collect data"
    ghenv.Component.AddRuntimeMessage(gh.Kernel.GH_RuntimeMessageLevel.Warning, msg)

if not G and not v:
    checkData = False
    msg = "Input parameter G or v failed to collect data"
    ghenv.Component.AddRuntimeMessage(gh.Kernel.GH_RuntimeMessageLevel.Warning, msg)

if not rho:
    checkData = False
    msg = "Input parameter rho failed to collect data"
    ghenv.Component.AddRuntimeMessage(gh.Kernel.GH_RuntimeMessageLevel.Warning, msg)



if checkData:
    uniAxialMaterial = alpaca.uniAxialMaterialElastic(name, E, Eneg, eta, G, v, rho)
# ---------- end uem ----------

crv_6 = Curve([internal_colum, external_colum])
explode_4 = Explode(Curve=crv_6, Recursive=True)  # -> Segments, Vertices
rs = RectangularSectionAlpaca4d(b="0.6", h="0.3", material=uem.uniAxialMaterial)  # -> out, Section
# ---------- rs: Python ----------
"""
Create a Rectangular Cross Section
-
    Args:
        secName:
        Area:
        Izz:
        Iyy:
        J:
        alphaY:
        alphaZ:
        material:
    Returns:
        Section:
"""
ghenv.Component.Name = "Rectangular Section (Alpaca4d)"
ghenv.Component.NickName = 'RS'
ghenv.Component.Message = "Rectangular Section (Alpaca4d)"

import sys
import Rhino.Geometry as rg
import Grasshopper as gh
import copy


## add alpaca install directory to system path

ghcompfolder = gh.Folders.DefaultAssemblyFolder
if ghcompfolder not in sys.path:
    sys.path.append(ghcompfolder)

try:
    from Alpaca4d import alpaca4d as alpaca
except:
    msg = "Cannot import Alpaca4d. Is the Alpaca4d folder available in " + ghcompfolder + "?"
    ghenv.Component.AddRuntimeMessage(gh.Kernel.GH_RuntimeMessageLevel.Error, msg)


checkData = True

if not b:
    checkData = False
    msg = "Input parameter b failed to collect data"
    ghenv.Component.AddRuntimeMessage(gh.Kernel.GH_RuntimeMessageLevel.Warning, msg)

if not h:
    checkData = False
    msg = "Input parameter h failed to collect data"
    ghenv.Component.AddRuntimeMessage(gh.Kernel.GH_RuntimeMessageLevel.Warning, msg)

if not material:
    checkData = False
    msg = "Input parameter material failed to collect data"
    ghenv.Component.AddRuntimeMessage(gh.Kernel.GH_RuntimeMessageLevel.Warning, msg)



if checkData:
    Section = alpaca.RectangularCS(secName, b,h,material)
# ---------- end rs ----------
fbc = ForceBeamColumnAlpaca4d(Line=explode_4.Segments, Section=rs.Section)  # -> Element; inputs Line: Curve, Colour: Color, Z_Axis: Vector3d
# ---------- fbc: Python ----------
"""
Create a Force Beam Column
-
    Args:
        Line:
        Section:
        Colour:
        Z_Axis:
    Returns:
        Element:
"""

ghenv.Component.Name = "Force Beam Column (Alpaca4d)"
ghenv.Component.NickName = 'FBC'
ghenv.Component.Message = "Force Beam Column (Alpaca4d)"


import sys
import Rhino.Geometry as rg
import Grasshopper as gh
import ghpythonlib.components as ghcomp
from System.Drawing import Color

## add alpaca install directory to system path

ghcompfolder = gh.Folders.DefaultAssemblyFolder
if ghcompfolder not in sys.path:
    sys.path.append(ghcompfolder)

try:
    from Alpaca4d import alpaca4d as alpaca
except:
    msg = "Cannot import Alpaca4d. Is the Alpaca4d folder available in " + ghcompfolder + "?"
    ghenv.Component.AddRuntimeMessage(gh.Kernel.GH_RuntimeMessageLevel.Error, msg)


checkData = True

if not Line:
    checkData = False
    msg = "Input parameter Line failed to collect data"
    ghenv.Component.AddRuntimeMessage(gh.Kernel.GH_RuntimeMessageLevel.Warning, msg)


if not Section:
    checkData = False
    msg = "Input parameter Section failed to collect data"
    ghenv.Component.AddRuntimeMessage(gh.Kernel.GH_RuntimeMessageLevel.Warning, msg)

if not Colour:
    Colour = Color.Red


if not GeomTransf:
    GeomTransf = "Linear"

if checkData:
    
    if not Z_Axis:
        midPoint =  Line.PointAtNormalizedLength(0.5)
        parameter = Line.ClosestPoint(midPoint, 0.01)[1]
        Z_Axis = ghcomp.PerpFrame( Line, parameter )
    Element = alpaca.ForceBeamColumn(Line, Section, GeomTransf, Colour, Z_Axis)
# ---------- end fbc ----------

crv_7 = Curve(merge_3)
explode_5 = Explode(Curve=crv_7, Recursive=True)  # -> Segments, Vertices
cs = CircularSectionAlpaca4d(d="0.6", t="0.01", material=uem.uniAxialMaterial)  # -> out, Section
# ---------- cs: Python ----------
"""
Create a Circle Cross Section
-
    Args:
        secName:
        Area:
        Izz:
        Iyy:
        J:
        alphaY:
        alphaZ:
        material:
    Returns:
        genericSection:
"""

ghenv.Component.Name = "Circular Section (Alpaca4d)"
ghenv.Component.NickName = 'CS'
ghenv.Component.Message = "Circular Section (Alpaca4d)"

import sys
import Rhino.Geometry as rg
import Grasshopper as gh
import copy


## add alpaca install directory to system path

ghcompfolder = gh.Folders.DefaultAssemblyFolder
if ghcompfolder not in sys.path:
    sys.path.append(ghcompfolder)

try:
    from Alpaca4d import alpaca4d as alpaca
except:
    msg = "Cannot import Alpaca4d. Is the Alpaca4d folder available in " + ghcompfolder + "?"
    ghenv.Component.AddRuntimeMessage(gh.Kernel.GH_RuntimeMessageLevel.Error, msg)


checkData = True

if not d:
    checkData = False
    msg = "Input parameter d failed to collect data"
    ghenv.Component.AddRuntimeMessage(gh.Kernel.GH_RuntimeMessageLevel.Warning, msg)

if not t:
    checkData = False
    msg = "Input parameter t failed to collect data"
    ghenv.Component.AddRuntimeMessage(gh.Kernel.GH_RuntimeMessageLevel.Warning, msg)

if not material:
    checkData = False
    msg = "Input parameter material failed to collect data"
    ghenv.Component.AddRuntimeMessage(gh.Kernel.GH_RuntimeMessageLevel.Warning, msg)



if checkData:
    Section = alpaca.CircleCS(secName,d,t,material)
# ---------- end cs ----------
fbc_2 = ForceBeamColumnAlpaca4d(Line=explode_5.Segments, Section=cs.Section)  # -> Element; inputs Line: Curve, Colour: Color, Z_Axis: Vector3d; same code as fbc

pfs = PlateFiberAlpaca4d(thickness="0.15", nDMaterial=eim.nDMaterial)  # -> out, Section
# ---------- pfs: Python ----------
"""
Create a Plate Fiber Section
-
    Args:
        secName:
        thickness:
        nDMaterial:
    Returns:
        Section:
"""


import sys
import Rhino.Geometry as rg
import Grasshopper as gh
import copy

ghenv.Component.Name = "Plate Fiber (Alpaca4d)"
ghenv.Component.NickName = 'PFS'
ghenv.Component.Message = "Plate Fiber (Alpaca4d)"


## add alpaca install directory to system path

ghcompfolder = gh.Folders.DefaultAssemblyFolder
if ghcompfolder not in sys.path:
    sys.path.append(ghcompfolder)

try:
    from Alpaca4d import alpaca4d as alpaca
except:
    msg = "Cannot import Alpaca4d. Is the Alpaca4d folder available in " + ghcompfolder + "?"
    ghenv.Component.AddRuntimeMessage(gh.Kernel.GH_RuntimeMessageLevel.Error, msg)


checkData = True

if not thickness:
    checkData = False
    msg = "Input parameter thickness failed to collect data"
    ghenv.Component.AddRuntimeMessage(gh.Kernel.GH_RuntimeMessageLevel.Warning, msg)

if not nDMaterial:
    checkData = False
    msg = "Input parameter nDMaterial failed to collect data"
    ghenv.Component.AddRuntimeMessage(gh.Kernel.GH_RuntimeMessageLevel.Warning, msg)

if checkData:
    Section = alpaca.PlateFiberSection(secName, thickness, nDMaterial)
# ---------- end pfs ----------

pt = Point(cullpt.Points)
toggle = BooleanToggle(True)
support = SupportAlpaca4d(Pos=pt, Tx=toggle, Ty=toggle, Tz=toggle, Rx=toggle, Ry=toggle, Rz=toggle)  # -> Support; inputs Pos: Point3d, Tx: Boolean, Ty: Boolean, Tz: Boolean, Rx: Boolean, Ry: Boolean, Rz: Boolean
# ---------- support: Python ----------
"""
Create a support
-
    Args:
        Pos:
        Tx:
        Ty:
        Tz:
        Rx:
        Ry:
    Returns:
        Support:
"""

ghenv.Component.Name = "Support (Alpaca4d)"
ghenv.Component.NickName = 'Support'
ghenv.Component.Message = "Support (Alpaca4d)"


import sys
import Rhino.Geometry as rg
import Grasshopper as gh


## add alpaca install directory to system path

ghcompfolder = gh.Folders.DefaultAssemblyFolder
if ghcompfolder not in sys.path:
    sys.path.append(ghcompfolder)

try:
    from Alpaca4d import alpaca4d as alpaca
except:
    msg = "Cannot import Alpaca4d. Is the Alpaca4d folder available in " + ghcompfolder + "?"
    ghenv.Component.AddRuntimeMessage(gh.Kernel.GH_RuntimeMessageLevel.Error, msg)

checkData = True


if not Pos:
    checkData = False
    msg = "Input parameter Pos failed to collect data"
    ghenv.Component.AddRuntimeMessage(gh.Kernel.GH_RuntimeMessageLevel.Warning, msg)

if checkData:
    Support = alpaca.Support(Pos, Tx, Ty, Tz, Rx, Ry, Rz)
# ---------- end support ----------

is = ISectionAlpaca4d(Bsup="0.3", tsup="0.01", Binf="0.3", tinf="0.01", H="0.6", tw="0.01", material=uem.uniAxialMaterial)  # -> Section
# ---------- is: Python ----------
"""
Create a double T Cross Section
-
    Args:
        secName:
        Bsup:
        tsup:
        Binf:
        tinf:
        H:
        tw:
        material:
    Returns:
        Section:
"""
ghenv.Component.Name = "I Section (Alpaca4d)"
ghenv.Component.NickName = 'IS'
ghenv.Component.Message = "I Section (Alpaca4d)"

import sys
import Rhino.Geometry as rg
import Grasshopper as gh
import copy



## add alpaca install directory to system path

ghcompfolder = gh.Folders.DefaultAssemblyFolder
if ghcompfolder not in sys.path:
    sys.path.append(ghcompfolder)

try:
    from Alpaca4d import alpaca4d as alpaca
except:
    msg = "Cannot import Alpaca4d. Is the Alpaca4d folder available in " + ghcompfolder + "?"
    ghenv.Component.AddRuntimeMessage(gh.Kernel.GH_RuntimeMessageLevel.Error, msg)


checkData = True

if not Bsup:
    checkData = False
    msg = "Input parameter Bsup failed to collect data"
    ghenv.Component.AddRuntimeMessage(gh.Kernel.GH_RuntimeMessageLevel.Warning, msg)

if not tsup:
    checkData = False
    msg = "Input parameter tsup failed to collect data"
    ghenv.Component.AddRuntimeMessage(gh.Kernel.GH_RuntimeMessageLevel.Warning, msg)

if not Binf:
    checkData = False
    msg = "Input parameter Binf failed to collect data"
    ghenv.Component.AddRuntimeMessage(gh.Kernel.GH_RuntimeMessageLevel.Warning, msg)

if not tinf:
    checkData = False
    msg = "Input parameter tinf failed to collect data"
    ghenv.Component.AddRuntimeMessage(gh.Kernel.GH_RuntimeMessageLevel.Warning, msg)

if not H:
    checkData = False
    msg = "Input parameter H failed to collect data"
    ghenv.Component.AddRuntimeMessage(gh.Kernel.GH_RuntimeMessageLevel.Warning, msg)

if not tw:
    checkData = False
    msg = "Input parameter tw failed to collect data"
    ghenv.Component.AddRuntimeMessage(gh.Kernel.GH_RuntimeMessageLevel.Warning, msg)

if not material:
    checkData = False
    msg = "Input parameter material failed to collect data"
    ghenv.Component.AddRuntimeMessage(gh.Kernel.GH_RuntimeMessageLevel.Warning, msg)



if checkData:
    Section = alpaca.I_Section(secName, Bsup, tsup, Binf, tinf, H, tw, material)
# ---------- end is ----------

crv_8 = Curve([internal_beam, outer_beam])
explode_6 = Explode(Curve=crv_8, Recursive=True)  # -> Segments, Vertices
cs_2 = CircularSectionAlpaca4d(d="0.6", t="0.01", material=uem.uniAxialMaterial)  # -> out, Section; same code as cs
fbc_3 = ForceBeamColumnAlpaca4d(Line=explode_6.Segments, Section=is)  # -> Element; inputs Line: Curve, Colour: Color, Z_Axis: Vector3d; same code as fbc

pt_2 = Point(flatten(explode_6.Vertices))
cullpt_2 = CullDuplicates(Points=pt_2, Tolerance=0.1, CullMode=3)  # -> Points, Indices, Valence
pt_3 = Point(cullpt_2.Points)
cts = ConstantTimeSeriesAlpaca4d()  # -> TimeSeries, Graph
# ---------- cts: Python ----------
"""
Create a Constant Time Series
-
    Args:
        tStart:
        tEnd:
        period:
        factor:
        shift:
    Returns:
        TimeSeries:
        Graph:
"""

ghenv.Component.Name = "Constant Time Series (Alpaca4d)"
ghenv.Component.NickName = 'CTS'
ghenv.Component.Message = "Constant Time Series (Alpaca4d)"


import sys
import Rhino.Geometry as rg
import Grasshopper as gh
import copy
import math


## add alpaca install directory to system path

ghcompfolder = gh.Folders.DefaultAssemblyFolder
if ghcompfolder not in sys.path:
    sys.path.append(ghcompfolder)

try:
    from Alpaca4d import alpaca4d as alpaca
except:
    msg = "Cannot import Alpaca4d. Is the Alpaca4d folder available in " + ghcompfolder + "?"
    ghenv.Component.AddRuntimeMessage(gh.Kernel.GH_RuntimeMessageLevel.Error, msg)

def ConstantSeries(x):
    return x



checkData = True

if not constantFactor:
    constantFactor = 1


if checkData:
    TimeSeries = alpaca.TimeSeriesConstant(constantFactor)
    
    Graph = []
    
    for x in range(10):
        Graph.append(ConstantSeries(constantFactor))
# ---------- end cts ----------
vec_6 = VectorXYZ(XComponent="-0.001", YComponent=0, ZComponent=0)  # -> Vector, Length
pl = PointLoadAlpaca4d(Pos=pt_3, Force=vec_6.Vector, TimeSeries=cts.TimeSeries)  # -> Load; inputs Pos: Point3d, Force: Vector3d, Moment: Vector3d
# ---------- pl: Python ----------
"""
Create a Point Load
-
    Args:
        Pos:
        Force:
        Moment:
        TimeSeries:
    Returns:
        PointLoad:
"""

ghenv.Component.Name = "Point Load (Alpaca4d)"
ghenv.Component.NickName = 'PL'
ghenv.Component.Message = "Point Load (Alpaca4d)"



import sys
import Rhino.Geometry as rg
import Grasshopper as gh
import copy


## add alpaca install directory to system path

ghcompfolder = gh.Folders.DefaultAssemblyFolder
if ghcompfolder not in sys.path:
    sys.path.append(ghcompfolder)

try:
    from Alpaca4d import alpaca4d as alpaca
except:
    msg = "Cannot import Alpaca4d. Is the Alpaca4d folder available in " + ghcompfolder + "?"
    ghenv.Component.AddRuntimeMessage(gh.Kernel.GH_RuntimeMessageLevel.Error, msg)


checkData = True

if not Pos:
    checkData = False
    msg = "Input parameter Pos failed to collect data"
    ghenv.Component.AddRuntimeMessage(gh.Kernel.GH_RuntimeMessageLevel.Warning, msg)

if not Force:
    Force = rg.Vector3d(0,0,0)

if not Moment:
    Moment = rg.Vector3d(0,0,0)

if not TimeSeries:
    checkData = False
    msg = "Input parameter TimeSeries failed to collect data"
    ghenv.Component.AddRuntimeMessage(gh.Kernel.GH_RuntimeMessageLevel.Warning, msg)


if checkData:
    Load = alpaca.PointLoad(Pos, Force, Moment, TimeSeries)
# ---------- end pl ----------

mitc4 = ShellMITC4Alpaca4d(Mesh=mesh, Section=pfs.Section, Colour=ColourSwatch(SwatchColor=RGB(60, 0, 255)))  # -> out, Element; inputs Mesh: Mesh, Colour: Color
# ---------- mitc4: Python ----------
"""
Create a ShellMITC4 element
-
    Args:
        Mesh:
        Section:
        Colour:
    Returns:
        Element:
"""

ghenv.Component.Name = "Shell MITC4 (Alpaca4d)"
ghenv.Component.NickName = 'MITC4'
ghenv.Component.Message = "ShellMITC4 (Alpaca4d)"
ghenv.Component.IconDisplayMode = ghenv.Component.IconDisplayMode.application
ghenv.Component.Category = "Alpaca4d"
ghenv.Component.SubCategory = "2_Element"



import sys
import Rhino.Geometry as rg
import Grasshopper as gh
from System.Drawing import Color


## add alpaca install directory to system path

ghcompfolder = gh.Folders.DefaultAssemblyFolder
if ghcompfolder not in sys.path:
    sys.path.append(ghcompfolder)

try:
    from Alpaca4d import alpaca4d as alpaca
except:
    msg = "Cannot import Alpaca4d. Is the Alpaca4d folder available in " + ghcompfolder + "?"
    ghenv.Component.AddRuntimeMessage(gh.Kernel.GH_RuntimeMessageLevel.Error, msg)


checkData = True

if not Mesh:
    checkData = False
    msg = "Input parameter Mesh failed to collect data"
    ghenv.Component.AddRuntimeMessage(gh.Kernel.GH_RuntimeMessageLevel.Warning, msg)

if not Section:
    checkData = False
    msg = "Input parameter Section failed to collect data"
    ghenv.Component.AddRuntimeMessage(gh.Kernel.GH_RuntimeMessageLevel.Warning, msg)

if not Colour:
    Colour = Color.Blue


if checkData:
    
    Mesh.Unweld(0,True)
    explodedMesh = Mesh.ExplodeAtUnweldedEdges()
    if explodedMesh.Length > 0:
        Element = []
        for mesh in explodedMesh:
            if mesh.Vertices.Count == 4:
                Element.append(alpaca.ShellMITC4(mesh, Section, Colour))
            elif mesh.Vertices.Count == 3:
                Element.append(alpaca.ShellNLDKGT(mesh, Section, Colour))
    elif explodedMesh.Length == 0:
        if Mesh.Vertices.Count == 4:
                Element = alpaca.ShellMITC4(Mesh, Section, Colour)
        elif Mesh.Vertices.Count == 3:
            Element = alpaca.ShellNLDKGT(Mesh, Section, Colour)
# ---------- end mitc4 ----------

panel_2 = Panel(rs.Section)
list = ValueList({"Core": 0, "Brace": 1}, selected="Brace")
entwine = Entwine(Branch00=mesh, Branch01=crv_7, Branch02=crv_6, Branch03=crv_8, FlattenInputs=True)
entwine_2 = Entwine(
    Branch00=ColourSwatch(SwatchColor=RGB(255, 255, 255)),
    Branch01=ColourSwatch(SwatchColor=RGB(255, 0, 0)),
    Branch02=ColourSwatch(SwatchColor=RGB(0, 21, 255)),
    Branch03=ColourSwatch(SwatchColor=RGB(59, 186, 0)),
    FlattenInputs=True)
filter = StreamFilter(Gate=list, Stream0=mitc4.Element, Stream1=fbc_2)
preview = CustomPreview(Geometry=entwine, Material=graft(entwine_2))
am = AssembleModelAlpaca4d(Element=flatten([filter, fbc, fbc_3]), Support=flatten(support), Load=flatten(pl))  # -> out, AlpacaModel, Mass; inputs Element: list, Support: list, Load: list, Constraint: list
# ---------- am: Python ----------
"""
Create a FEA Model
-
    Args:
        Element:
        Support:
        Load:
        Constraint:
    Returns:
        AlpacaModel:
"""


import os
import sys
import ghpythonlib.treehelpers as th
import Rhino.Geometry as rg
import Rhino.Collections as rc
import rhinoscriptsyntax as rs
from collections import defaultdict, OrderedDict
import copy
import time
import Grasshopper as gh


ghenv.Component.Name = "Assemble Model (Alpaca4d)"
ghenv.Component.NickName = 'AM'
ghenv.Component.Message = "Assemble Model (Alpaca4d)"


## add alpaca install directory to system path

ghcompfolder = gh.Folders.DefaultAssemblyFolder
if ghcompfolder not in sys.path:
    sys.path.append(ghcompfolder)

try:
    from Alpaca4d import alpaca4d as alpaca
except:
    msg = "Cannot import Alpaca4d. Is the Alpaca4d folder available in " + ghcompfolder + "?"
    ghenv.Component.AddRuntimeMessage(gh.Kernel.GH_RuntimeMessageLevel.Error, msg)


checkData = True

if not Element:
    checkData = False
    msg = "Input parameter Element failed to collect data"
    ghenv.Component.AddRuntimeMessage(gh.Kernel.GH_RuntimeMessageLevel.Warning, msg)

if not Support:
    checkData = False
    msg = "Input parameter Support failed to collect data"
    ghenv.Component.AddRuntimeMessage(gh.Kernel.GH_RuntimeMessageLevel.Warning, msg)


if checkData:
    
    FolderPath = rs.DocumentPath()
    os.chdir(FolderPath)
    
    # create the object model
    AlpacaModel = alpaca.Model()
    
    
    start = time.clock()
    #subdivide element per type
    
    for element in Element:
        if element.type == "Beam":
            AlpacaModel.beams.append(element)
        elif element.type == "Shell":
            AlpacaModel.shells.append(element)
        elif element.type == "Brick":
            AlpacaModel.bricks.append(element)
    
    
    end = time.clock() - start
    print("time to subdivide element {}".format(end))
    start = time.clock()
    
    # create a list of unique point
    # need to add the rigid constraint
    
    AlpacaModel.getuniquePoints(AlpacaModel.beams, AlpacaModel.shells, AlpacaModel.bricks, Constraint)
    
    
    end = time.clock() - start
    print("time to get uniquepoints {}".format(end))
    start = time.clock()
    
    
    #############
    # create node and assign to object
    #############
    
    if AlpacaModel.uniquePointsThreeNDF:
        AlpacaModel.py.append(alpaca.Model.write3ndf_tcl())
        for point in AlpacaModel.uniquePointsThreeNDF:
            node = alpaca.Node(point)
            node.ndf = 3
            node.setNodeTag(AlpacaModel)
            AlpacaModel.nodes.append( node )
        
            AlpacaModel.py.append(node.write_tcl())
    
    
    if AlpacaModel.uniquePointsSixNDF:
        AlpacaModel.py.append(alpaca.Model.write6ndf_tcl())
        for point in AlpacaModel.uniquePointsSixNDF:
            node = alpaca.Node(point)
            node.ndf = 6
            node.setNodeTag(AlpacaModel)
            AlpacaModel.nodes.append( node )
         
            AlpacaModel.py.append(node.write_tcl())
    
    
    
    end = time.clock() - start
    print("time to create node and assign tag {}".format(end))
    start = time.clock()
    
    
    #################
    # create supports
    #################
    
    for supportNode in Support:
        
        # if the list is empty, skip this operation
        if AlpacaModel.uniquePointsThreeNDF:
            closestPointInThreeNDF = rc.Point3dList.ClosestPointInList(AlpacaModel.uniquePointsThreeNDF, supportNode.Pos)
            if supportNode.Pos.DistanceTo(closestPointInThreeNDF) < 0.001:
                #print("I am in 3ndf")
                supportNode.ndf = 3
                AlpacaModel.threeNDFModel.append(supportNode)
                supportNode.setNodeTag(AlpacaModel)
        
        if AlpacaModel.uniquePointsSixNDF:
            closestPointInSixNDF = rc.Point3dList.ClosestPointInList(AlpacaModel.uniquePointsSixNDF, supportNode.Pos)
            if supportNode.Pos.DistanceTo(closestPointInSixNDF) < 0.001:
                supportNode.ndf = 6
                AlpacaModel.sixNDFModel.append(supportNode)
                supportNode.setNodeTag(AlpacaModel)
        
        
        AlpacaModel.supports.append(supportNode)
        AlpacaModel.py.append(supportNode.write_tcl())
    
    
    end = time.clock() - start
    print("time to create support and assign tag {}".format(end))
    start = time.clock()
    
    
    ####################
    # create constraints
    ####################
    
    
    for constraint in Constraint:
        constraint.setNodeTag(AlpacaModel)
        AlpacaModel.constraints.append(constraint)
    
    ####################
    # create equalDOF when the model has 3df and 6df together
    ####################
    
    
    end = time.clock() - start
    print("time to create constraint and assign tag {}".format(end))
    start = time.clock()
    
    
    Id = []
    IdB = []
    
    def SearchCallback(sender, e):
        Id.Add(e.Id)
        IdB.Add(e.IdB)
    
    
    
    lenThreeNDF = len(AlpacaModel.uniquePointsThreeNDF)
    lenSixNDF = len(AlpacaModel.uniquePointsSixNDF)
    
    
    if not(lenThreeNDF == 0 or lenSixNDF == 0):
        print("brick and beam together")
        rg.RTree.SearchOverlaps(AlpacaModel.RTreeCloudPointThreeNDF, AlpacaModel.RTreeCloudPointSixNDF, 0.001, SearchCallback)
        
        for i,j in zip(Id, IdB):
            print(i,j)
            node_i = AlpacaModel.uniquePointsThreeNDF[i]
            node_j = AlpacaModel.uniquePointsSixNDF[j]
            
            #index_i = AlpacaModel.cloudPoint.ClosestPoint(node_i) + 1
            #index_j = AlpacaModel.cloudPoint.ClosestPoint(node_j) + 1
            
            equalConstraint = alpaca.EqualDOF(node_i, node_j, True, True, True, False, False, False)
            equalConstraint.masterNodeTag = AlpacaModel.cloudPointThreeNDF.ClosestPoint(node_i) + 1
            equalConstraint.slaveNodesTag = AlpacaModel.cloudPointSixNDF.ClosestPoint(node_j) + 1 + len(AlpacaModel.uniquePointsThreeNDF)
            AlpacaModel.py.append(equalConstraint.write_tcl())
    
    
    
    end = time.clock() - start
    print("time to find common points between 3ndf and 6ndf {}".format(end))
    start = time.clock()
    
    ##########################
    ##########################
    ##########################
    
    crossSection = []
    material = []
    
    for item in Element:
        crossSection.append(item.CrossSection)
        material.append(item.CrossSection.material)
    
    uniqueCS = list(set(crossSection))
    uniqueMaterial = list(set(material))
    
    for index, material in enumerate(uniqueMaterial,1):
        material.matTag = index
        AlpacaModel.py.append(material.write_tcl())
    
    
    for index, section in enumerate(uniqueCS,1):
        section.sectionTag = index
        AlpacaModel.py.append(section.write_tcl())
        
    
    
    
    
    
    # write py file
    
    
    # assign tag and node Index to element and shell
    for index, element in enumerate(Element,1):
        element.setTopologyRTree(AlpacaModel)
        element.eleTag = index
        element.setTags()
    
    
    
    end = time.clock() - start
    print("time to assign tags for the elements {}".format(end))
    start = time.clock()
    
    
    
    Mass = 0
    IsGravity = False
    
    for item in Load:
        if item.type == "Gravity Load":
            IsGravity = True
            GravityLoad = item
        if item.type == "PointLoad":
            AlpacaModel.loads.append(item)
    
    
    for item in Element:
        if item.type == "Beam":
            length = item.Crv.GetLength()
            Mass += (item.massDens * length)
            if IsGravity:
                gravityPointLoad = alpaca.PointLoad(item.Crv.PointAtStart, rg.Vector3d(0,0, -(item.massDens * length / 2)) * GravityLoad.GravityFactor, rg.Vector3d(0,0,0), GravityLoad.TimeSeries)
                #print( -(item.massDens * length / 2))
                AlpacaModel.loads.append(gravityPointLoad)
        if item.type == "Shell":
            meshArea = rg.AreaMassProperties.Compute(item.Mesh).Area
            areaDensity = item.CrossSection.thickness * item.CrossSection.material.rho
            Mass += areaDensity * meshArea
            if IsGravity:
                for vertex in item.Mesh.Vertices.ToPoint3dArray():
                    gravityPointLoad = alpaca.PointLoad(vertex, rg.Vector3d(0,0, -(areaDensity * meshArea/ len(item.Mesh.Vertices))) * GravityLoad.GravityFactor, rg.Vector3d(0,0,0), GravityLoad.TimeSeries)
                    AlpacaModel.loads.append(gravityPointLoad)
        if item.type == "Brick":
            #print(type(item.Mesh))
            meshVolume = rg.VolumeMassProperties.Compute(item.Mesh).Volume
            density = item.material.rho 
            Mass += density * meshVolume
            if IsGravity:
                for vertex in item.Mesh.Vertices.ToPoint3dArray():
                    gravityPointLoad = alpaca.PointLoad(vertex, rg.Vector3d(0,0, -(density * meshVolume / len(item.Mesh.Vertices))) * GravityLoad.GravityFactor, rg.Vector3d(0,0,0), GravityLoad.TimeSeries)
                    #print(len(item.Mesh.Vertices))
                    #print(density)
                    # volume can be zero if mesh faces are not properly rotated
                    #print(meshVolume)
                    #print(-(density * meshVolume / len(item.Mesh.Vertices)))
                    AlpacaModel.loads.append(gravityPointLoad)
    
    #print(AlpacaModel.loads)
    ## load
    
    
    for item in AlpacaModel.loads:
        item.setNodeTag(AlpacaModel)
    
    #print(AlpacaModel.loads)
    
    for item in AlpacaModel.beams:
        AlpacaModel.py.append(item.write_tcl())
    
    for item in AlpacaModel.shells:
        AlpacaModel.py.append(item.write_tcl())
    
    for item in AlpacaModel.bricks:
        AlpacaModel.py.append(item.write_tcl())
    
    
    for item in Constraint:
        AlpacaModel.py.append(item.write_tcl())
    
    
    timeSeriesDict = alpaca.TimeSeries.getTimeSeries(AlpacaModel.loads)[1]
    AlpacaModel.py.append(alpaca.PointLoad.write_tcl(timeSeriesDict,AlpacaModel))
    
    
    text = AlpacaModel.py
# ---------- end am ----------
panel_3 = Panel("1")  # disabled
as = AnalysesStepsAlpaca4d(numIncr=panel_3)  # -> AnalysisSteps; inputs numIncr: Int32; disabled
# ---------- as: Python ----------
"""
Define the Analysis Step
-
    Inputs:
        numIncr:
        dt:
        dtMin:
        dtMAx:
        Jd:
    Output:
        AnalysisSteps:
"""



ghenv.Component.Name = "Analyses Steps (Alpaca4d)"
ghenv.Component.NickName = 'AS'
ghenv.Component.Message = "Analyses Steps (Alpaca4d)"
ghenv.Component.IconDisplayMode = ghenv.Component.IconDisplayMode.application
ghenv.Component.Category = "Alpaca4d"
ghenv.Component.SubCategory = "7_Analysis"



import sys
import Rhino.Geometry as rg
import Grasshopper as gh
import ghpythonlib.components as ghcomp
from System.Drawing import Color

## add alpaca install directory to system path

ghcompfolder = gh.Folders.DefaultAssemblyFolder
if ghcompfolder not in sys.path:
    sys.path.append(ghcompfolder)

try:
    from Alpaca4d import alpaca4d as alpaca
except:
    msg = "Cannot import Alpaca4d. Is the Alpaca4d folder available in " + ghcompfolder + "?"
    ghenv.Component.AddRuntimeMessage(gh.Kernel.GH_RuntimeMessageLevel.Error, msg)

dt = "" if dt is None else dt
dtMin = "" if dtMin is None else dtMin
dtMax = "" if dtMax is None else dtMax
Jd = "" if Jd is None else Jd

checkData = True

if not numIncr:
    checkData = False
    msg = "Input parameter numIncr failed to collect data"
    ghenv.Component.AddRuntimeMessage(gh.Kernel.GH_RuntimeMessageLevel.Warning, msg)

if checkData:
    AnalysisSteps = alpaca.AnalysisSteps(numIncr, dt, dtMin, dtMax, Jd)
# ---------- end as ----------
as_2 = AnalysisSettingsAlpaca4d(AnalysisSteps=as)  # -> Settings; disabled
# ---------- as_2: Python ----------
"""
Create Analysis settings
-
    Args:
        Constraint: 'Plain', 'Transformation'. Default is 'Transformation'.
        Numberer: 'RCM', 'AMD', 'Plain'. Default is 'RCM'.
        System: 'BandGen', 'BandSPD', 'ProfileSPD', 'SuperLU', 'UmfPack', 'FullGeneral', 'SparseSYM'. Default is 'BandSPD'.
        Test: Feature not implemented. Please contact alpaca4d@gmail.com 
        Algorithm: 'Linear', 'Newton', 'NewtonLineSearch', 'ModifiedNewton', 'KrylovNewton', 'SecantNewton', 'BFGS', 'Broyden'. Default is 'Linear'.
        Integrator: Default is LoadControl.
        AnalysisType: 'Static', 'Transient'. Default is 'Static'.
        AnalyesSteps:
    Returns:
        Analysis:
"""

import sys
import os


import clr
import clrtype
import Rhino.Geometry as rg
import rhinoscriptsyntax as rs
import Grasshopper as gh
import copy
import ghpythonlib.treehelpers as th


ghenv.Component.Name = "Analysis settings (Alpaca4d)"
ghenv.Component.NickName = 'AS'
ghenv.Component.Message = "Analysis settings \n(Alpaca4d)"



from Alpaca4d import alpaca4d as alpaca

checkData = True


# default Value
Constraint = 'Transformation' if Constraint is None else Constraint
ConstraintList = ['Plain', 'Transformation']

for item in ConstraintList:
    if Constraint.lower() == item.lower():
        print(item)
        Constraint = item


# default Value
Numberer = 'RCM' if Numberer is None else Numberer
NumbererList = ['RCM', 'AMD', 'Plain', 'ParallelPlain', 'ParallelRCM']

for i,item in enumerate(NumbererList):
    if Numberer.lower() == item.lower():
        Numberer = item



# default Value
System = 'BandSPD' if System is None else System
SystemList = ['BandGen', 'BandSPD', 'ProfileSPD', 'SuperLU', 'UmfPack', 'FullGeneral', 'SparseSYM']

for i,item in enumerate(SystemList):
    if System.lower() == item.lower():
        System = item


# default Test
Test = 'NormDispIncr 1.0e-6 12 5' if Test is None else Test




# default Value
Algorithm = 'Linear' if Algorithm is None else Algorithm
AlgorithmList = ['Linear', 'Newton', 'NewtonLineSearch', 'ModifiedNewton', 'KrylovNewton', 'SecantNewton', 'BFGS', 'Broyden']

for i,item in enumerate(AlgorithmList):
    if Algorithm.lower() == item.lower():
        Algorithm = item


# default Value
AnalysisType = 'Static' if AnalysisType is None else AnalysisType
AnalysisTypeList = ['Static', 'Transient']

for item in AnalysisTypeList:
    if AnalysisType.lower() == item.lower():
        AnalysisType = item


## Define Integrator
if AnalysisType == "Static":
    Integrator = "LoadControl 1.0" if Integrator is None else Integrator
elif AnalysisType == "Transient":
    Integrator = "Newmark 0.5 0.25" if Integrator is None else Integrator



if not AnalysisSteps:
    checkData = False
    msg = "Input parameter AnalysisSteps failed to collect data"
    ghenv.Component.AddRuntimeMessage(gh.Kernel.GH_RuntimeMessageLevel.Warning, msg)


if checkData:
    Settings = alpaca.Analysis(Constraint, Numberer,System,Test,Algorithm,Integrator,AnalysisType, AnalysisSteps)
    print(Settings.write_tcl())
# ---------- end as_2 ----------
ra = RunAnalysisAlpaca4d(AlpacaModel=am.AlpacaModel, Settings=as_2)  # -> log, AlpacaSolvedModel; disabled
# ---------- ra: Python ----------
"""
Run an OpenSees Analysis
-
    Args:
        AlpacaModel:
        Settings:
    Returns:
        AlpacaSolvedModel:
"""



import Rhino.RhinoDoc
import Grasshopper as gh
import copy
import rhinoscriptsyntax as rs
import os
import time
import sys



ghenv.Component.Name = "Run Analysis (Alpaca4d)"
ghenv.Component.NickName = 'RA'
ghenv.Component.Message = "Run Analysis (Alpaca4d)"

ghcompfolder = gh.Folders.DefaultAssemblyFolder
if ghcompfolder not in sys.path:
    sys.path.append(ghcompfolder)

try:
    from Alpaca4d import alpaca4d as alpaca
except:
    msg = "Cannot import Alpaca4d. Is the Alpaca4d folder available in " + ghcompfolder + "?"
    ghenv.Component.AddRuntimeMessage(gh.Kernel.GH_RuntimeMessageLevel.Error, msg)


checkData = True



if not AlpacaModel:
    checkData = False
    msg = "Input parameter AlpacaModel failed to collect data"
    ghenv.Component.AddRuntimeMessage(gh.Kernel.GH_RuntimeMessageLevel.Warning, msg)


if not Settings:
    checkData = False
    msg = "Input parameter Settings failed to collect data"
    ghenv.Component.AddRuntimeMessage(gh.Kernel.GH_RuntimeMessageLevel.Warning, msg)


if checkData:
    FolderPath = rs.DocumentPath()
    os.chdir(FolderPath)
    
    outputFileName = 'openSeesModel'
    recorderFileName = 'recorder.mpco'
    
    for dirpath, dirnames, filenames in os.walk(FolderPath):
        for filename in filenames:
            if filename == outputFileName:
                file = os.path.join(dirpath,outputFileName)
                os.remove(file)
            elif filename == recorderFileName:
                file = os.path.join(dirpath,recorderFileName)
                os.remove(file)
    
    
    # create a copy
    
    AnalysisModel = copy.copy(AlpacaModel)
    AnalysisModel.py = list(AnalysisModel.py)
    
    # generate Recorder and assign name
    AnalysisModel.recorderName = "recorder" + ".mpco"
    
    if Settings.AnalysisType == "Static":
        recorder = alpaca.TCLRecorder.mpco(AnalysisModel.recorderName, True,True,False,False,True,True,False,False,True,True,True,True)
    elif Settings.AnalysisType == "Transient":
        recorder = alpaca.TCLRecorder.mpco(AnalysisModel.recorderName, True,True,True,True,True,True,False,False,True,True,True,True)
    
    AnalysisModel.py.append(recorder)
    
    
    AnalysisModel.analysis = Settings
    AnalysisModel.py.append(Settings.write_tcl())
    AnalysisModel.py.append("wipe")
    
    
    #textFile = AnalysisModel.py
    
    time_start = time.clock()
    
    AnalysisModel.writeFile(outputFileName)
    
    time_elapsed = (time.clock() - time_start)
    print("Writing Time {}".format(time_elapsed))
    
    
    
    time_start = time.clock()
    
    executable = os.path.join(ghcompfolder,'Alpaca4d\OpenSees-Solvers\opensees.bat')
    a, log = AnalysisModel.runOpensees(executable)
    
    
    time_elapsed = (time.clock() - time_start)
    print("Analyses Time {}".format(time_elapsed))
    
    AlpacaSolvedModel = copy.copy(AnalysisModel)
    AlpacaSolvedModel.isAnalysed = True
# ---------- end ra ----------
number_slider = Slider(11, range=0..12)  # disabled
clr = ColorsAlpaca4d(gradIndex=number_slider)  # -> reverse(colors); inputs gradIndex: Int32; disabled
#   port colors: A series of colors to be plugged into the "Ladybug_Legend Parameters" component.
# ---------- clr: Python ----------
"""
Preset of gradient colors perfect for Data Visualisation
    Inputs:
        gradIndex: An index refering to one of the following possible gradients:
            0 - Orignal Ladybug
            1 - Nuanced Ladybug
            2 - Multi-colored Ladybug
            3 - Ecotect
            4 - Thermal Comfort Percentage
            5 - Thermal Comfort Colors
            6 - Shade Benefit/Harm
            7 - Shade Harm
            8 - Shade Benefit
            9 - CFD Colors 1
            10 - Radiation Benefit
            11 - Gsa10 Colour
            12 - Gsa9 Colour
    Returns:
        customColors: A series of colors.
"""

ghenv.Component.Name = "Colors (Alpaca4d)"
ghenv.Component.NickName = 'CLR'
ghenv.Component.Message = 'Colors (Alpaca4d)'

import scriptcontext as sc
import Grasshopper.Kernel as gh
import System

gradientLibrary = {
        0: [System.Drawing.Color.FromArgb(75, 107, 169), System.Drawing.Color.FromArgb(115, 147, 202), System.Drawing.Color.FromArgb(170, 200, 247), System.Drawing.Color.FromArgb(193, 213, 208), System.Drawing.Color.FromArgb(245, 239, 103), System.Drawing.Color.FromArgb(252, 230, 74), System.Drawing.Color.FromArgb(239, 156, 21), System.Drawing.Color.FromArgb(234, 123, 0), System.Drawing.Color.FromArgb(234, 74, 0), System.Drawing.Color.FromArgb(234, 38, 0)],
        1: [System.Drawing.Color.FromArgb(49,54,149), System.Drawing.Color.FromArgb(69,117,180), System.Drawing.Color.FromArgb(116,173,209), System.Drawing.Color.FromArgb(171,217,233), System.Drawing.Color.FromArgb(224,243,248), System.Drawing.Color.FromArgb(255,255,191), System.Drawing.Color.FromArgb(254,224,144), System.Drawing.Color.FromArgb(253,174,97), System.Drawing.Color.FromArgb(244,109,67), System.Drawing.Color.FromArgb(215,48,39), System.Drawing.Color.FromArgb(165,0,38)],
        2: [System.Drawing.Color.FromArgb(4,25,145), System.Drawing.Color.FromArgb(7,48,224), System.Drawing.Color.FromArgb(7,88,255), System.Drawing.Color.FromArgb(1,232,255), System.Drawing.Color.FromArgb(97,246,156), System.Drawing.Color.FromArgb(166,249,86), System.Drawing.Color.FromArgb(254,244,1), System.Drawing.Color.FromArgb(255,121,0), System.Drawing.Color.FromArgb(239,39,0), System.Drawing.Color.FromArgb(138,17,0)],
        3: [System.Drawing.Color.FromArgb(0,0,255), System.Drawing.Color.FromArgb(53,0,202), System.Drawing.Color.FromArgb(107,0,148), System.Drawing.Color.FromArgb(160,0,95), System.Drawing.Color.FromArgb(214,0,41), System.Drawing.Color.FromArgb(255,12,0), System.Drawing.Color.FromArgb(255,66,0), System.Drawing.Color.FromArgb(255,119,0), System.Drawing.Color.FromArgb(255,173,0), System.Drawing.Color.FromArgb(255,226,0), System.Drawing.Color.FromArgb(255,255,0)],
        4: [System.Drawing.Color.FromArgb(0,0,0), System.Drawing.Color.FromArgb(110,0,153), System.Drawing.Color.FromArgb(255,0,0), System.Drawing.Color.FromArgb(255,255,102), System.Drawing.Color.FromArgb(255,255,255)],
        5: [System.Drawing.Color.FromArgb(0,136,255), System.Drawing.Color.FromArgb(200,225,255), System.Drawing.Color.FromArgb(255,255,255), System.Drawing.Color.FromArgb(255,230,230), System.Drawing.Color.FromArgb(255,0,0)],
        6: [System.Drawing.Color.FromArgb(5,48,97), System.Drawing.Color.FromArgb(33,102,172), System.Drawing.Color.FromArgb(67,147,195), System.Drawing.Color.FromArgb(146,197,222), System.Drawing.Color.FromArgb(209,229,240), System.Drawing.Color.FromArgb(255,255,255), System.Drawing.Color.FromArgb(253,219,199), System.Drawing.Color.FromArgb(244,165,130), System.Drawing.Color.FromArgb(214,96,77), System.Drawing.Color.FromArgb(178,24,43), System.Drawing.Color.FromArgb(103,0,31)],
        7: [System.Drawing.Color.FromArgb(255,255,255), System.Drawing.Color.FromArgb(253,219,199), System.Drawing.Color.FromArgb(244,165,130), System.Drawing.Color.FromArgb(214,96,77), System.Drawing.Color.FromArgb(178,24,43), System.Drawing.Color.FromArgb(103,0,31)],
        8: [System.Drawing.Color.FromArgb(255,255,255), System.Drawing.Color.FromArgb(209,229,240), System.Drawing.Color.FromArgb(146,197,222), System.Drawing.Color.FromArgb(67,147,195), System.Drawing.Color.FromArgb(33,102,172), System.Drawing.Color.FromArgb(5,48,97)],
        9: [System.Drawing.Color.FromArgb(0,16,120), System.Drawing.Color.FromArgb(38,70,160), System.Drawing.Color.FromArgb(5,180,222), System.Drawing.Color.FromArgb(16,180,109), System.Drawing.Color.FromArgb(59,183,35), System.Drawing.Color.FromArgb(143,209,19), System.Drawing.Color.FromArgb(228,215,29), System.Drawing.Color.FromArgb(246,147,17), System.Drawing.Color.FromArgb(243,74,0), System.Drawing.Color.FromArgb(255,0,0)],
        10: [System.Drawing.Color.FromArgb(0,191,48), System.Drawing.Color.FromArgb(255,238,184), System.Drawing.Color.FromArgb(255,0,0)],
        11: [System.Drawing.Color.FromArgb(204,0,71), System.Drawing.Color.FromArgb(255,182,71), System.Drawing.Color.FromArgb(206,255,115), System.Drawing.Color.FromArgb(26,180, 214),System.Drawing.Color.FromArgb(0,0,207)],
        12: [System.Drawing.Color.FromArgb(255, 51, 51), System.Drawing.Color.FromArgb(255, 170, 51), System.Drawing.Color.FromArgb(255, 255, 51), System.Drawing.Color.FromArgb(170, 255, 125), System.Drawing.Color.FromArgb(51, 255, 231), System.Drawing.Color.FromArgb(51, 170, 255), System.Drawing.Color.FromArgb(51,51, 255)]}
colors = gradientLibrary[gradIndex]
# ---------- end clr ----------
panel_4 = Panel("3")  # disabled
toggle_2 = BooleanToggle(True)  # disabled
dm = DeformedModelAlpaca4d(AlpacaSolvedModel=ra.AlpacaSolvedModel, scale=panel_4, extrudeModel=toggle_2, listColor=clr)  # -> DefModel, bounds; inputs step: Int32, extrudeModel: Boolean, typeColor: Int32, listColor: list of Color; disabled
# ---------- dm: Python ----------
"""View Deformed model
    Args:
        AlpacaSolvedModel: Output of Analyses solver
        step:
        scale: Multiplication factor for displacement
        extrudeModel:  
True : view extruded model
else : view stick model
        typeColor:  View relative color of the traslation
<=0 : view traslation X 
1 : view traslation Y
2 : view traslation Z
>= 3 : view resulting displacement.
        listColor : one list of color 

    Output:
       DefModel: view deformed model
       bounds: max end min of displacement of the structure 
"""

ghenv.Component.Name = "Deformed Model (Alpaca4d)"
ghenv.Component.NickName = 'DM'
ghenv.Component.Message = "Deformed Model (Alpaca4d)"

from ghpythonlib.componentbase import executingcomponent as component
import System
import rhinoscriptsyntax as rs

import sys
import os
import clr
import clrtype
import Rhino.Geometry as rg
import Rhino as rc
import math as mt
import Grasshopper as gh
import ghpythonlib.treehelpers as th
from ghpythonlib.components import ConstructDomain

ghcompfolder = gh.Folders.DefaultAssemblyFolder
if ghcompfolder not in sys.path:
    sys.path.append(ghcompfolder)
try:
    from Alpaca4d import alpaca4dView as alpacaView
except:
    msg = "Cannot import Alpaca4d. Is the Alpaca4d folder available in " + ghcompfolder + "?"
    ghenv.Component.AddRuntimeMessage(gh.Kernel.GH_RuntimeMessageLevel.Error, msg)
    
FolderPath = rs.DocumentPath()
os.chdir(FolderPath)

ghcompfolder = gh.Folders.DefaultAssemblyFolder
my_module_name = "Alpaca_StepReader"
my_module = sys.modules.setdefault(my_module_name, type(sys)(my_module_name))


try:
    Steps_dm = my_module.Steps_dm
    Modes = my_module.Modes
except AttributeError:
    type_2d = type(System.Array.CreateInstance(float, 1, 1))

    class Steps_dm(object):
        __metaclass__ = clrtype.ClrClass
        _clrfields = {"STEP_{}".format(i): type_2d for i in range(1000)} # it will work for model with less than 1000 steps

    class Modes(object):
        __metaclass__ = clrtype.ClrClass
        _clrfields = {"MODE_{}".format(i): type_2d for i in range(1000)} # it will work for model with less than 1000 steps

    my_module.Steps_dm = Steps_dm
    my_module.Modes = Modes


hdfFilePath = os.path.join(ghcompfolder, "Alpaca4d\HDF5CSharp.dll")
clr.AddReferenceToFileAndPath(hdfFilePath)

from HDF5CSharp import Hdf5

class MyComponent(component):
    
    def RunScript(self, AlpacaSolvedModel, step = None, scale = None , extrudeModel = None, typeColor = None, listColor = [] ):
        import sys
        
        self.extrudeModel = extrudeModel
        
        self.defModel1 = []
        self.defModel2 = []
        self.defModel3 = []
        
        self.beamColor = []
        

        if step == None:
            step = 0
        if extrudeModel == None:
            extrudeModel = False
        if typeColor == None:
            typeColor = 3
        
        if not listColor: listColor = [ System.Drawing.Color.DarkViolet, 
                                        System.Drawing.Color.BlueViolet, 
                                        System.Drawing.Color.RoyalBlue, 
                                        System.Drawing.Color.CornflowerBlue,
                                        System.Drawing.Color.LightSkyBlue, 
                                        System.Drawing.Color.LightBlue,
                                        System.Drawing.Color.CadetBlue,
                                        System.Drawing.Color.LightGreen,
                                        System.Drawing.Color.GreenYellow,
                                        System.Drawing.Color.Yellow,
                                        System.Drawing.Color.Orange,
                                        System.Drawing.Color.Red,
                                        System.Drawing.Color.DarkRed]
            
        checkData = True
        
        if not AlpacaSolvedModel:
            checkData = False
            msg = "Input parameter AlpacaSolvedModel failed to collect data"
            ghenv.Component.AddRuntimeMessage(gh.Kernel.GH_RuntimeMessageLevel.Warning, msg)
        else:
            try:
                fileId = Hdf5.OpenFile(AlpacaSolvedModel.recorderName, True)
                print( AlpacaSolvedModel.recorderName)
                numberOfPoints = len(AlpacaSolvedModel.uniquePoints) #
                
                displacement = []
                rotation = []
                dispNodeList = []
                
                if AlpacaSolvedModel.isModal == True:
                    print( AlpacaSolvedModel.isModal == True )
                    outputData = "MODEL_STAGE[1]/RESULTS/ON_NODES/MODES_OF_VIBRATION(U)/DATA/STEP_0"
                    print( outputData )
                    displacementResult = Hdf5.ReadObject[Modes](fileId, outputData)
                    for i in range(numberOfPoints):
                        tag = i + 1
                        vx = getattr(displacementResult, 'MODE_{}'.format(step))[i,0]
                        vy = getattr(displacementResult, 'MODE_{}'.format(step))[i,1]
                        vz = getattr(displacementResult, 'MODE_{}'.format(step))[i,2]
                        trasl = rg.Vector3d(vx,vy,vz)
                        displacement.append(trasl)
                        dispNodeList.append( [tag, trasl] )
                        
                    Hdf5.CloseFile(fileId)
                    print("I have closed the file")
                else: 
                    outputData = "/MODEL_STAGE[1]/RESULTS/ON_NODES/DISPLACEMENT/DATA"
                    print( outputData )
                    displacementResult = Hdf5.ReadObject[Steps_dm](fileId, outputData)
                    for i in range(numberOfPoints):
                        tag = i + 1
                        vx = getattr(displacementResult, 'STEP_{}'.format(step))[i,0]
                        vy = getattr(displacementResult, 'STEP_{}'.format(step))[i,1]
                        vz = getattr(displacementResult, 'STEP_{}'.format(step))[i,2]
                        trasl = rg.Vector3d(vx,vy,vz)
                        displacement.append(trasl)
                        dispNodeList.append( [tag, trasl] )
                        
                    Hdf5.CloseFile(fileId)
                    print("I have closed the file")
            
                dispNodeDict = dict( dispNodeList )
                #---------------------------------------------------#
                defEleVector1 = alpacaView.BeamVectorDef(AlpacaSolvedModel,dispNodeDict) #beam
                defEleVector2 = alpacaView.ShellVectorDef(AlpacaSolvedModel,dispNodeDict) #shell
                defEleVector3 = alpacaView.BrickVectorDef(AlpacaSolvedModel,dispNodeDict) #shell
                bound = alpacaView.boundsDef(displacement, typeColor)
                if scale == None: scale = 1/bound[1]
                if self.extrudeModel == None or self.extrudeModel == False:
                    #BEAM
                    defModel1 = alpacaView.BeamDef(AlpacaSolvedModel, dispNodeDict,scale)
                    self.defModel1, self.beamColor = alpacaView.ColorBeamDef( defModel1, defEleVector1, bound, listColor, typeColor)
                    #SHELL
                    defModel2 = alpacaView.ShellDef(AlpacaSolvedModel,dispNodeDict,scale)
                    #BRICK
                    defModel3 = alpacaView.BrickDef(AlpacaSolvedModel,dispNodeDict,scale)
                else:
                    #BEAM
                    defModel1 = alpacaView.BeamDefExtrude(AlpacaSolvedModel, dispNodeDict,scale)
                    self.defModel1 = alpacaView.ColorBeamDefExtrude( defModel1, defEleVector1, bound, listColor, typeColor)
                    #SHELL
                    defModel2 = alpacaView.ShellDefExtrude(AlpacaSolvedModel,dispNodeDict,scale)
                    #BRICK
                    defModel3 = alpacaView.BrickDef(AlpacaSolvedModel,dispNodeDict,scale)
                    
                #SHELL COLOR
                self.defModel2 = alpacaView.ColorShellDef( defModel2, defEleVector2 , bound, listColor, typeColor, extrudeModel )
                #BRICK COLOR
                self.defModel3 = alpacaView.ColorBrickDef( defModel3, defEleVector3 , bound, listColor, typeColor)
                DefModel = th.list_to_tree(self.defModel1 + defModel2 + defModel3)
                bounds = ConstructDomain(bound[0], bound[1])
                return (DefModel, bounds)
            except:
                Hdf5.CloseFile(fileId)
                print("I have closed the file due to exception")
            # return outputs if you have them; here I try it for you:
        
        
    def DrawViewportWires(self,arg):
        for iMesh in self.defModel2 :
            colorWirframe = System.Drawing.Color.Black
            arg.Display.DrawMeshWires(iMesh, colorWirframe)
            
        for iMesh in self.defModel3 :
            colorWirframe = System.Drawing.Color.Black
            arg.Display.DrawMeshWires(iMesh, colorWirframe)
        if self.extrudeModel is None or self.extrudeModel is False:
            thickness =2
            for iBeam, iColor in zip(self.defModel1, self.beamColor) :
                for jBeam, jColor in zip(iBeam, iColor):
                    arg.Display.DrawCurve(jBeam, jColor, thickness)
        else:
            for iBeam in self.defModel1 :
                colorWirframe = System.Drawing.Color.Black
                arg.Display.DrawMeshWires(iBeam, colorWirframe)
# ---------- end dm ----------
rf = ReactionForcesAlpaca4d(AlpacaModel=ra.AlpacaSolvedModel)  # -> out, SupportPosition, ReactionForce, ReactionMoment; inputs History: Boolean, step: Int32; disabled
# ---------- rf: Python ----------
"""
Read Reaction Forces
    Args:
        AlpacaModel:
        History:
        step:
    Returns:
        SupportPosition:
        ReactionForce:
        ReactionMoment:
        ReactionForce_History:
        ReactionMoment_History:
"""

ghenv.Component.Name = "Reaction Forces (Alpaca4d)"
ghenv.Component.NickName = 'RF'
ghenv.Component.Message = 'Reactions (Alpaca4d)'


import sys
import os
import System
from System.Drawing import Color


import clr
import clrtype
import Rhino.Geometry as rg
import rhinoscriptsyntax as rs
import Grasshopper as gh
import copy
import ghpythonlib.treehelpers as th



## add alpaca install directory to system path

ghcompfolder = gh.Folders.DefaultAssemblyFolder
if ghcompfolder not in sys.path:
    sys.path.append(ghcompfolder)

try:
    from Alpaca4d import alpaca4d as alpaca
except:
    msg = "Cannot import Alpaca4d. Is the Alpaca4d folder available in " + ghcompfolder + "?"
    ghenv.Component.AddRuntimeMessage(gh.Kernel.GH_RuntimeMessageLevel.Error, msg)



FolderPath = rs.DocumentPath()
os.chdir(FolderPath)

my_module_name = "Alpaca_StepReader" # replace this with something unique that doesn't collide with a real module!
my_module = sys.modules.setdefault(my_module_name, type(sys)(my_module_name))

hdfFilePath = os.path.join(ghcompfolder, "Alpaca4d\HDF5CSharp.dll")
clr.AddReferenceToFileAndPath(hdfFilePath)


from HDF5CSharp import Hdf5

try:
    Steps = my_module.Steps
except AttributeError:
    type_2d = type(System.Array.CreateInstance(float, 1, 1))

    class Steps(object):
        __metaclass__ = clrtype.ClrClass
        _clrfields = {"STEP_{}".format(i): type_2d for i in range(1000)} # it will work for model with less than 1000 steps

    my_module.Steps = Steps



checkData = True

if not AlpacaModel:
    checkData = False
    msg = "Input parameter AlpacaModel failed to collect data"
    ghenv.Component.AddRuntimeMessage(gh.Kernel.GH_RuntimeMessageLevel.Warning, msg)



History = False if History is None else History


if checkData:
    step = (int(AlpacaModel.analysis.AnalysisSteps.numIncr) - 1) if step is None else step
    supportTagLocation = [item.nodeTag - 1 for item in AlpacaModel.supports] #
    
    if not History:
    
        try:
            fileId = Hdf5.OpenFile(AlpacaModel.recorderName, True)
            
            
            reactionForceResult = Hdf5.ReadObject[Steps](fileId, "/MODEL_STAGE[1]/RESULTS/ON_NODES/REACTION_FORCE/DATA")
            ReactionForce = []
            for i in supportTagLocation:
                x = getattr(reactionForceResult, 'STEP_{}'.format(step))[i,0]
                y = getattr(reactionForceResult, 'STEP_{}'.format(step))[i,1]
                z = getattr(reactionForceResult, 'STEP_{}'.format(step))[i,2]
                ReactionForce.append(rg.Vector3d(x,y,z))
            
            
            ReactionMomentResult = Hdf5.ReadObject[Steps](fileId, "/MODEL_STAGE[1]/RESULTS/ON_NODES/REACTION_MOMENT/DATA")
            ReactionMoment = []
            for i in supportTagLocation:
                x = getattr(ReactionMomentResult, 'STEP_{}'.format(step))[i,0]
                y = getattr(ReactionMomentResult, 'STEP_{}'.format(step))[i,1]
                z = getattr(ReactionMomentResult, 'STEP_{}'.format(step))[i,2]
                ReactionMoment.append(rg.Vector3d(x,y,z))
                
            Hdf5.CloseFile(fileId)
            
        except:
            if fileId >0:
                Hdf5.CloseFile(fileId)
                print("I have closed the file")
    
    
    if History:
        try:
            fileId = Hdf5.OpenFile(AlpacaModel.recorderName, True)
        
            maxNumberStep = int(AlpacaModel.analysis.AnalysisSteps.numIncr)
            
            reactionForceResult = Hdf5.ReadObject[Steps](fileId, "/MODEL_STAGE[1]/RESULTS/ON_NODES/REACTION_FORCE/DATA")
            ReactionForce = []
            for i in supportTagLocation:
                reactionForceTemp = []
                for n_step in range(maxNumberStep):
                    x = getattr(reactionForceResult, 'STEP_{}'.format(n_step))[i,0]
                    y = getattr(reactionForceResult, 'STEP_{}'.format(n_step))[i,1]
                    z = getattr(reactionForceResult, 'STEP_{}'.format(n_step))[i,2]
                    reactionForceTemp.append(rg.Vector3d(x,y,z))
            
                ReactionForce.append(reactionForceTemp)
    
    
            reactionMomentResult = Hdf5.ReadObject[Steps](fileId, "/MODEL_STAGE[1]/RESULTS/ON_NODES/REACTION_MOMENT/DATA")
            ReactionMoment = []
            for i in supportTagLocation:
                reactionMomentTemp = []
                for n_step in range(maxNumberStep):
                    x = getattr(reactionMomentResult, 'STEP_{}'.format(n_step))[i,0]
                    y = getattr(reactionMomentResult, 'STEP_{}'.format(n_step))[i,1]
                    z = getattr(reactionMomentResult, 'STEP_{}'.format(n_step))[i,2]
                    reactionMomentTemp.append(rg.Vector3d(x,y,z))
            
                ReactionMoment.append(reactionMomentTemp)
            Hdf5.CloseFile(fileId)
            
        except:
            Hdf5.CloseFile(fileId)
    
    
    
    
    SupportPosition = [item.Pos for item in AlpacaModel.supports]
    ReactionForce = th.list_to_tree(ReactionForce)
    ReactionMoment = th.list_to_tree(ReactionMoment)
# ---------- end rf ----------
nd = NodalDisplacementsAlpaca4d(AlpacaModel=ra.AlpacaSolvedModel)  # -> out, displacement, rotation, port, velocity, acceleration; inputs History: Boolean, step: Int32; disabled
# ---------- nd: Python ----------
"""
Read displacement results
-
    Args:
        AlpacaModel:
        History: True to visualise the displacement and rotation history of the points
        step:
    Returns:
        displacement:
        rotation:
        displacement_History:
        rotation_History:
"""

ghenv.Component.Name = "Nodal Displacements (Alpaca4d)"
ghenv.Component.NickName = 'ND'
ghenv.Component.Message = "Displacements (Alpaca4d)"

import sys
import os
import System
from System.Drawing import Color


import clr
import clrtype
import Rhino.Geometry as rg
import rhinoscriptsyntax as rs
import Grasshopper as gh
import copy
import ghpythonlib.treehelpers as th



## add alpaca install directory to system path

ghcompfolder = gh.Folders.DefaultAssemblyFolder
if ghcompfolder not in sys.path:
    sys.path.append(ghcompfolder)

try:
    from Alpaca4d import alpaca4d as alpaca
except:
    msg = "Cannot import Alpaca4d. Is the Alpaca4d folder available in " + ghcompfolder + "?"
    ghenv.Component.AddRuntimeMessage(gh.Kernel.GH_RuntimeMessageLevel.Error, msg)



FolderPath = rs.DocumentPath()
os.chdir(FolderPath)

my_module_name = "Alpaca_StepReader" # replace this with something unique that doesn't collide with a real module!
my_module = sys.modules.setdefault(my_module_name, type(sys)(my_module_name))

hdfFilePath = os.path.join(ghcompfolder, "Alpaca4d\HDF5CSharp.dll")
clr.AddReferenceToFileAndPath(hdfFilePath)


from HDF5CSharp import Hdf5

try:
    Steps = my_module.Steps
except AttributeError:
    type_2d = type(System.Array.CreateInstance(float, 1, 1))

    class Steps(object):
        __metaclass__ = clrtype.ClrClass
        _clrfields = {"STEP_{}".format(i): type_2d for i in range(3000)} # it will work for model with less than 1000 steps

    my_module.Steps = Steps



checkData = True

if not AlpacaModel:
    checkData = False
    msg = "Input parameter AlpacaModel failed to collect data"
    ghenv.Component.AddRuntimeMessage(gh.Kernel.GH_RuntimeMessageLevel.Warning, msg)



History = False if History is None else History


if checkData:
    step = (int(AlpacaModel.analysis.AnalysisSteps.numIncr) - 1) if step is None else step
    numberOfPoints = len(AlpacaModel.uniquePoints) #
    
    if not History:
        try:
            fileId = Hdf5.OpenFile(AlpacaModel.recorderName, True)
            
            
            displacementResult = Hdf5.ReadObject[Steps](fileId, "/MODEL_STAGE[1]/RESULTS/ON_NODES/DISPLACEMENT/DATA")
            displacement = []
            for i in range(numberOfPoints):
                x = getattr(displacementResult, 'STEP_{}'.format(step))[i,0]
                y = getattr(displacementResult, 'STEP_{}'.format(step))[i,1]
                z = getattr(displacementResult, 'STEP_{}'.format(step))[i,2]
                displacement.append(rg.Vector3d(x,y,z))
            
            
            rotationResult = Hdf5.ReadObject[Steps](fileId, "/MODEL_STAGE[1]/RESULTS/ON_NODES/ROTATION/DATA")
            rotation = []
            for i in range(numberOfPoints):
                x = getattr(rotationResult, 'STEP_{}'.format(step))[i,0]
                y = getattr(rotationResult, 'STEP_{}'.format(step))[i,1]
                z = getattr(rotationResult, 'STEP_{}'.format(step))[i,2]
                rotation.append(rg.Vector3d(x,y,z))
            
            
            
            if AlpacaModel.analysis.AnalysisType == "Transient":
                velocityResult = Hdf5.ReadObject[Steps](fileId, "/MODEL_STAGE[1]/RESULTS/ON_NODES/VELOCITY/DATA")
                velocity = []
                for i in range(numberOfPoints):
                    x = getattr(velocityResult, 'STEP_{}'.format(step))[i,0]
                    y = getattr(velocityResult, 'STEP_{}'.format(step))[i,1]
                    z = getattr(velocityResult, 'STEP_{}'.format(step))[i,2]
                    velocity.append(rg.Vector3d(x,y,z))
    
    
    
                accelerationResult = Hdf5.ReadObject[Steps](fileId, "/MODEL_STAGE[1]/RESULTS/ON_NODES/ACCELERATION/DATA")
                acceleration = []
                for i in range(numberOfPoints):
                    x = getattr(accelerationResult, 'STEP_{}'.format(step))[i,0]
                    y = getattr(accelerationResult, 'STEP_{}'.format(step))[i,1]
                    z = getattr(accelerationResult, 'STEP_{}'.format(step))[i,2]
                    acceleration.append(rg.Vector3d(x,y,z))

                
                
            Hdf5.CloseFile(fileId)
            print("I have closed the file")
        except:
            if fileId >0:
                Hdf5.CloseFile(fileId)
                print("I have closed the file because of exception")
    
    
    
    if History:
        try:
            fileId = Hdf5.OpenFile(AlpacaModel.recorderName, True)
            
            displacementResult = Hdf5.ReadObject[Steps](fileId, "/MODEL_STAGE[1]/RESULTS/ON_NODES/DISPLACEMENT/DATA")
            displacement = []
            
            for i in range(numberOfPoints):
                dispTemp = []
                maxNumberStep = int(AlpacaModel.analysis.AnalysisSteps.numIncr)
                for n_step in range(maxNumberStep):
                    x = getattr(displacementResult, 'STEP_{}'.format(n_step))[i,0]
                    y = getattr(displacementResult, 'STEP_{}'.format(n_step))[i,1]
                    z = getattr(displacementResult, 'STEP_{}'.format(n_step))[i,2]
                    dispTemp.append(rg.Vector3d(x,y,z))
                    
                
                displacement.append(dispTemp)
    
    
    
            rotationResult = Hdf5.ReadObject[Steps](fileId, "/MODEL_STAGE[1]/RESULTS/ON_NODES/ROTATION/DATA")
            
            rotation = []
            
            for i in range(numberOfPoints):
                rotationTemp = []
                for n_step in range(maxNumberStep):
                    x = getattr(rotationResult, 'STEP_{}'.format(n_step))[i,0]
                    y = getattr(rotationResult, 'STEP_{}'.format(n_step))[i,1]
                    z = getattr(rotationResult, 'STEP_{}'.format(n_step))[i,2]
                    rotationTemp.append(rg.Vector3d(x,y,z))
                
                rotation.append(rotationTemp)
    
    
            if AlpacaModel.analysis.AnalysisType == "Transient":
                velocityResult = Hdf5.ReadObject[Steps](fileId, "/MODEL_STAGE[1]/RESULTS/ON_NODES/VELOCITY/DATA")
                
                velocity = []
                
                for i in range(numberOfPoints):
                    velocityTemp = []
                    for n_step in range(maxNumberStep):
                        x = getattr(velocityResult, 'STEP_{}'.format(n_step))[i,0]
                        y = getattr(velocityResult, 'STEP_{}'.format(n_step))[i,1]
                        z = getattr(velocityResult, 'STEP_{}'.format(n_step))[i,2]
                        velocityTemp.append(rg.Vector3d(x,y,z))
                    
                    velocity.append(velocityTemp)
    
    
    
                accelerationResult = Hdf5.ReadObject[Steps](fileId, "/MODEL_STAGE[1]/RESULTS/ON_NODES/ACCELERATION/DATA")
                
                acceleration = []
                
                for i in range(numberOfPoints):
                    accelerationTemp = []
                    for n_step in range(maxNumberStep):
                        x = getattr(accelerationResult, 'STEP_{}'.format(n_step))[i,0]
                        y = getattr(accelerationResult, 'STEP_{}'.format(n_step))[i,1]
                        z = getattr(accelerationResult, 'STEP_{}'.format(n_step))[i,2]
                        accelerationTemp.append(rg.Vector3d(x,y,z))
                    
                    acceleration.append(accelerationTemp)




            Hdf5.CloseFile(fileId)
        except:
            Hdf5.CloseFile(fileId)
            print("I have closed the file because an exception")
    
    
    displacement = th.list_to_tree(displacement)
    rotation = th.list_to_tree(rotation)
    
    if AlpacaModel.analysis.AnalysisType == "Transient":
        velocity = th.list_to_tree(velocity)
        acceleration = th.list_to_tree(acceleration)
    else:
        velocity = []
        acceleration = []
# ---------- end nd ----------
mesh_2 = Mesh(dm.DefModel)  # disabled
devec = DeconstructVector(Vector=nd.displacement)  # -> XComponent, YComponent, ZComponent; disabled
graph = QuickGraph(devec.XComponent, SortOrder=0)  # disabled
