# Grasshopper definition Ex_Elements_Brick.gh (Grasshopper 1.0.7)
# plug-ins: Kangaroo2 Components

data = Data(flatten(Tree({0;0;0}: [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], {0;0;1}: [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], {0;0;2}: [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], {0;0;3}: [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], {0;0;4}: [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], {0;0;5}: [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]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)))
mstb = MeshSeriesToBrickAlpaca4d(MeshSeries=data)  # -> simplify(flatten(Brick)); inputs MeshSeries: list of Mesh
# ---------- mstb: Python ----------
"""Generate a Brick element from a list of mesh .
    the faces of the mesh '0' will be connected with the faces of the meshes '1' generating a brick element ( cube ).
    Attention : Each mesh in the list must have the same number of faces.
    Inputs:
        MeshSeries: quadMesh list with the same number of subdivisions .
    Output:
        Brick: Brick element --> Mesh with 6 faces and 8 nodes.
       """
import Rhino.Geometry as rg
import Grasshopper as gh

def MeshToShell(Mesh):
    
    Mesh.Unweld(0, True)
    mesh = Mesh.ExplodeAtUnweldedEdges()
    #print( len(mesh) )
    newMesh = []
    elementType = []
    for explodedMesh in mesh:
        newMesh.append(explodedMesh)
    return newMesh 

def brick( MeshList ):
    meshExpl = []
    Vertix = []
    elementType = []
    solid = []
    a = rg.Mesh.DuplicateMesh( MeshList[0] ) #.Unweld(0, True)
    a.Unweld(0, True)
    b = a.ExplodeAtUnweldedEdges()
    if len( b ) > 0 :
        for Mesh in MeshList:
            shellWrapper = MeshToShell(Mesh)
            meshExpl.append( shellWrapper )
        for index1 in range(0, len(MeshList)-1):
            for index2 in range(0, len(meshExpl[0])):
                if meshExpl[ index1 ][ index2 ].Vertices.Count == 4:
                    
                    elementType.append("stdBrick")
                    vertix1 = meshExpl[ index1 ][ index2 ].Vertices[0]
                    vertix2 = meshExpl[ index1 ][ index2 ].Vertices[1]
                    vertix3 = meshExpl[ index1 ][ index2 ].Vertices[2]
                    vertix4 = meshExpl[ index1 ][ index2 ].Vertices[3]
                    vertix5 = meshExpl[index1 + 1 ][ index2].Vertices[0]
                    vertix6 = meshExpl[index1 + 1 ][ index2].Vertices[1]
                    vertix7 = meshExpl[index1 + 1 ][ index2].Vertices[2]
                    vertix8 = meshExpl[index1 + 1 ][ index2].Vertices[3]
                    
                    vertix = [ vertix1, vertix2, vertix3, vertix4,
                    vertix5, vertix6, vertix7, vertix8 ]
                    
                    ele = rg.Mesh()
                    
                    ele.Vertices.Add( vertix1 ) # 0 
                    ele.Vertices.Add( vertix2 ) # 1
                    ele.Vertices.Add( vertix3 ) # 2
                    ele.Vertices.Add( vertix4 ) # 3
                    ele.Vertices.Add( vertix5 ) # 4
                    ele.Vertices.Add( vertix6 ) # 5
                    ele.Vertices.Add( vertix7 ) # 6
                    ele.Vertices.Add( vertix8 ) # 7
                    
                    ele.Faces.AddFace(0, 1, 2, 3) # 0
                    ele.Faces.AddFace(4, 5, 6, 7) # 1
                    ele.Faces.AddFace(0, 1, 5, 4) # 2
                    ele.Faces.AddFace(3, 2, 6, 7) # 3
                    ele.Faces.AddFace(1, 5, 6, 2) # 4
                    ele.Faces.AddFace(0, 4, 7, 3) # 5
                solid.append(ele)
                #ele.IsClosed()
                    
    else:
        for index1 in range(0, len(MeshList)-1):
            elementType.append("stdBrick")
            vertix1 = MeshList[ index1 ].Vertices[0]
            vertix2 = MeshList[ index1 ].Vertices[1]
            vertix3 = MeshList[ index1 ].Vertices[2]
            vertix4 = MeshList[ index1 ].Vertices[3]
            vertix5 = MeshList[index1 + 1 ].Vertices[0]
            vertix6 = MeshList[index1 + 1 ].Vertices[1]
            vertix7 = MeshList[index1 + 1 ].Vertices[2]
            vertix8 = MeshList[index1 + 1 ].Vertices[3]
            
            vertix = [ vertix1, vertix2, vertix3, vertix4,
            vertix5, vertix6, vertix7, vertix8 ]
            
            ele = rg.Mesh()
            
            ele.Vertices.Add( vertix1 ) # 0 
            ele.Vertices.Add( vertix2 ) # 1
            ele.Vertices.Add( vertix3 ) # 2
            ele.Vertices.Add( vertix4 ) # 3
            ele.Vertices.Add( vertix5 ) # 4
            ele.Vertices.Add( vertix6 ) # 5
            ele.Vertices.Add( vertix7 ) # 6
            ele.Vertices.Add( vertix8 ) # 7
            
            ele.Faces.AddFace(0, 1, 2, 3) # 0
            ele.Faces.AddFace(4, 5, 6, 7) # 1
            ele.Faces.AddFace(0, 1, 5, 4) # 2
            ele.Faces.AddFace(3, 2, 6, 7) # 3
            ele.Faces.AddFace(1, 5, 6, 2) # 4
            ele.Faces.AddFace(0, 4, 7, 3) # 5
            
            solid.append(ele)
            '''
            else :
                elementType.append(["FourNodeTetrahedron"]*3)
                
                if meshExpl[ index1 ][ index2 ].Vertices[0] == meshExpl[index1 + 1 ][ index2].Vertices[0] :
                    vertix1 = meshExpl[ index1 ][ index2 ].Vertices[0]
                    vertix2 = meshExpl[ index1 ][ index2 ].Vertices[1]
                    vertix3 = meshExpl[ index1 ][ index2 ].Vertices[2]
                    vertix4 = meshExpl[index1 + 1 ][ index2].Vertices[1]
                    vertix5 = meshExpl[index1 + 1 ][ index2].Vertices[2]
                    
                    vertixEle1 = [ vertix1, vertix2, vertix3, vertix4 ]
                    vertixEle2 = [ vertix1, vertix2, vertix3, vertix2 ]
                    
                    ele1 = rg.Mesh() # Tetrahedron 1
                    ele2 = rg.Mesh() # Tetrahedron 2
                    
                    ele1.Vertices.Add( vertix1 ) # 0 
                    ele1.Vertices.Add( vertix2 ) # 1
                    ele1.Vertices.Add( vertix3 ) # 2 
                    ele1.Vertices.Add( vertix4 ) # 3 
                    
                    ele1.VertexColors.Add(color)
                    ele1.VertexColors.Add(color)
                    ele1.VertexColors.Add(color)
                    ele1.VertexColors.Add(color)
                    
                    ele2.Vertices.Add( vertix1 ) # 0 
                    ele2.Vertices.Add( vertix2 ) # 1 
                    ele2.Vertices.Add( vertix3 ) # 2 
                    ele2.Vertices.Add( vertix2 ) # 3
    
                    ele2.VertexColors.Add(color)
                    ele2.VertexColors.Add(color)
                    ele2.VertexColors.Add(color)
                    ele2.VertexColors.Add(color)
                    
                    ele1.Faces.AddFace(0, 1, 4 ) # 0
                    ele1.Faces.AddFace(0, 1, 3 ) # 1
                    ele1.Faces.AddFace(0, 4, 3 ) # 2
                    ele1.Faces.AddFace(1, 3, 4 ) # 3
                    
                    ele2.Faces.AddFace(0, 1, 3 ) # 0
                    ele2.Faces.AddFace(0, 1, 2 ) # 1
                    ele2.Faces.AddFace(1, 2, 3 ) # 2
                    ele2.Faces.AddFace(0, 2, 3 ) # 3
                    
                    ele = [ ele1, ele2 ]
                    
                else :
                
                    vertix1 = meshExpl[ index1 ][ index2 ].Vertices[0]
                    vertix2 = meshExpl[ index1 ][ index2 ].Vertices[1]
                    vertix3 = meshExpl[ index1 ][ index2 ].Vertices[2]
                    vertix4 = meshExpl[index1 + 1 ][ index2].Vertices[0]
                    vertix5 = meshExpl[index1 + 1 ][ index2].Vertices[1]
                    vertix6 = meshExpl[index1 + 1 ][ index2].Vertices[2]
                    
                    vertixEle1 = [ vertix1, vertix2, vertix3, vertix6 ]
                    vertixEle2 = [ vertix4, vertix5, vertix6, vertix1 ]
                    vertixEle3 = [ vertix5, vertix6, vertix2, vertix1 ]
                    
                    vertix = [ vertixEle1, vertixEle2, vertixEle3 ]
                    
                    ele1 = rg.Mesh() # Tetrahedron 1
                    ele2 = rg.Mesh() # Tetrahedron 2
                    ele3 = rg.Mesh() # Tetrahedron 3
                    
                    ele1.Vertices.Add( vertix1 ) # 0 
                    ele1.Vertices.Add( vertix2 ) # 1
                    ele1.Vertices.Add( vertix3 ) # 2 
                    ele1.Vertices.Add( vertix6 ) # 3 
                    
                    ele1.VertexColors.Add(color)
                    ele1.VertexColors.Add(color)
                    ele1.VertexColors.Add(color)
                    ele1.VertexColors.Add(color)
                    
                    ele2.Vertices.Add( vertix4 ) # 0 
                    ele2.Vertices.Add( vertix5 ) # 1 
                    ele2.Vertices.Add( vertix6 ) # 2 
                    ele2.Vertices.Add( vertix1 ) # 3
    
                    ele2.VertexColors.Add(color)
                    ele2.VertexColors.Add(color)
                    ele2.VertexColors.Add(color)
                    ele2.VertexColors.Add(color)
                    
                    ele3.Vertices.Add( vertix5 ) # 0 
                    ele3.Vertices.Add( vertix6 ) # 1 
                    ele3.Vertices.Add( vertix2 ) # 2 
                    ele3.Vertices.Add( vertix1 ) # 3
                    
                    ele3.VertexColors.Add(color)
                    ele3.VertexColors.Add(color)
                    ele3.VertexColors.Add(color)
                    ele3.VertexColors.Add(color)
                    
                    ele1.Faces.AddFace(0, 1, 2 ) # 0
                    ele1.Faces.AddFace(0, 3, 1 ) # 1
                    ele1.Faces.AddFace(0, 3, 2 ) # 2
                    ele1.Faces.AddFace(1, 3, 2 ) # 3
                    
                    ele2.Faces.AddFace(0, 1, 2 ) # 0
                    ele2.Faces.AddFace(0, 3, 1 ) # 1
                    ele2.Faces.AddFace(0, 3, 2 ) # 2
                    ele2.Faces.AddFace(1, 3, 2 ) # 3
                    
                    ele3.Faces.AddFace(0, 1, 2 ) # 0
                    ele3.Faces.AddFace(0, 3, 1 ) # 1
                    ele3.Faces.AddFace(0, 3, 2 ) # 2
                    ele3.Faces.AddFace(1, 3, 2 ) # 3
                    
                    ele = [ ele1, ele2, ele3 ]
            
            solid.append(ele)
            Vertix.append( vertix )
            '''
    return solid

checkData = True

if not MeshSeries or len(MeshSeries) == 1 :  #is not None:
    checkData = False
    msg = "input 'MeshSeries' failed to collect data"
    ghenv.Component.AddRuntimeMessage( gh.Kernel.GH_RuntimeMessageLevel.Warning, msg )

if checkData != False:
    Brick= brick( MeshSeries )
# ---------- end mstb ----------
item = ListItem(List=data, Index=0, Wrap=True)  # -> Item1, Item
demesh = DeconstructMesh(Mesh=[item.Item, item.Item1])  # -> Vertices, Faces, Colours, Normals
duppt = RemoveDuplicatePts(Points=flatten(demesh.Vertices), Tolerance=0.01)

# ---- group: Element
data_2 = Data(0)
data_3 = Data(0)

# ---- group: Load
# instagram:    Alpaca4d
# facebook:     Alpaca4d
# mail:         alpaca4d@gmail.com
data_4 = Data(0)
data_5 = Data(0)

# ---- group: Cross-Section
data_6 = Data(0)
data_7 = Data(0)

# ---- group: Support
data_8 = Data(0)
data_9 = Data(0)

# ---- group: Material
data_10 = Data(0)
data_11 = Data(0)

# ---- group: Constraint
data_12 = Data(0)
data_13 = Data(0)

# ---- group: Material
division = Division(A="30000*1000", B=2)
num = Number("30000*1000")
eim = ElasticIsotropicMaterialAlpaca4d(E=num, G=division, rho="2500")  # -> out, nDMaterial
# ---------- eim: Python ----------
"""
Create a nD Elastic Isotropic Material
-
    Args:
        name:
        E:
        G:
        v:
        rho:
    Returns:
        nDMaterial:
"""

ghenv.Component.Name = "Elastic Isotropic Material (Alpaca4d)"
ghenv.Component.NickName = 'EIM'
ghenv.Component.Message = "Elastic Isotropic (Alpaca4d)"


import sys
import Rhino.Geometry as rg
import Grasshopper as gh
import copy


## add alpaca install directory to system path

ghcompfolder = gh.Folders.DefaultAssemblyFolder
if ghcompfolder not in sys.path:
    sys.path.append(ghcompfolder)

try:
    from Alpaca4d import alpaca4d as alpaca
except:
    msg = "Cannot import Alpaca4d. Is the Alpaca4d folder available in " + ghcompfolder + "?"
    ghenv.Component.AddRuntimeMessage(gh.Kernel.GH_RuntimeMessageLevel.Error, msg)


checkData = True

if not E:
    checkData = False
    msg = "Input parameter E failed to collect data"
    ghenv.Component.AddRuntimeMessage(gh.Kernel.GH_RuntimeMessageLevel.Warning, msg)

if not G and not v:
    checkData = False
    msg = "Input parameter G or v failed to collect data"
    ghenv.Component.AddRuntimeMessage(gh.Kernel.GH_RuntimeMessageLevel.Warning, msg)

if not rho:
    checkData = False
    msg = "Input parameter rho failed to collect data"
    ghenv.Component.AddRuntimeMessage(gh.Kernel.GH_RuntimeMessageLevel.Warning, msg)

if checkData:
    nDMaterial = alpaca.ElasticIsotropic(name, E, G, rho, v)
# ---------- end eim ----------

# ---- group: Support
toggle = BooleanToggle(True)
point = Point(duppt)
support = SupportAlpaca4d(Pos=point, Tx=toggle, Ty=toggle, Tz=toggle, Rx=toggle, Ry=toggle, Rz=toggle)  # -> Support; inputs Pos: Point3d, Tx: Boolean, Ty: Boolean, Tz: Boolean, Rx: Boolean, Ry: Boolean, Rz: Boolean
# ---------- support: Python ----------
"""
Create a support
-
    Args:
        Pos:
        Tx:
        Ty:
        Tz:
        Rx:
        Ry:
    Returns:
        Support:
"""

ghenv.Component.Name = "Support (Alpaca4d)"
ghenv.Component.NickName = 'Support'
ghenv.Component.Message = "Support (Alpaca4d)"


import sys
import Rhino.Geometry as rg
import Grasshopper as gh


## add alpaca install directory to system path

ghcompfolder = gh.Folders.DefaultAssemblyFolder
if ghcompfolder not in sys.path:
    sys.path.append(ghcompfolder)

try:
    from Alpaca4d import alpaca4d as alpaca
except:
    msg = "Cannot import Alpaca4d. Is the Alpaca4d folder available in " + ghcompfolder + "?"
    ghenv.Component.AddRuntimeMessage(gh.Kernel.GH_RuntimeMessageLevel.Error, msg)

checkData = True


if not Pos:
    checkData = False
    msg = "Input parameter Pos failed to collect data"
    ghenv.Component.AddRuntimeMessage(gh.Kernel.GH_RuntimeMessageLevel.Warning, msg)

if checkData:
    Support = alpaca.Support(Pos, Tx, Ty, Tz, Rx, Ry, Rz)
# ---------- end support ----------

# ----
lts = LinearTimeSeriesAlpaca4d()  # -> TimeSeries, Graph
# ---------- lts: Python ----------
"""
Create a Linear Time Series
-
    Args:
        tStart:
        tEnd:
        period:
        factor:
        shift:
    Returns:
        TimeSeries:
        Graph:
"""

ghenv.Component.Name = "Linear Time Series (Alpaca4d)"
ghenv.Component.NickName = 'LTS'
ghenv.Component.Message = "Linear Time Series (Alpaca4d)"

import sys
import Rhino.Geometry as rg
import Grasshopper as gh
import copy
import math


## add alpaca install directory to system path

ghcompfolder = gh.Folders.DefaultAssemblyFolder
if ghcompfolder not in sys.path:
    sys.path.append(ghcompfolder)

try:
    from Alpaca4d import alpaca4d as alpaca
except:
    msg = "Cannot import Alpaca4d. Is the Alpaca4d folder available in " + ghcompfolder + "?"
    ghenv.Component.AddRuntimeMessage(gh.Kernel.GH_RuntimeMessageLevel.Error, msg)


def linearSeries(x):
    return x



checkData = True

if not linearFactor:
    linearFactor = 1




if checkData:
    TimeSeries = alpaca.TimeSeriesLinear(linearFactor)
    
    Graph = []
    
    for x in range(10):
        Graph.append(linearSeries(x * linearFactor))
# ---------- end lts ----------

# ---- group: Load
cts = ConstantTimeSeriesAlpaca4d()  # -> TimeSeries, Graph
# ---------- cts: Python ----------
"""
Create a Constant Time Series
-
    Args:
        tStart:
        tEnd:
        period:
        factor:
        shift:
    Returns:
        TimeSeries:
        Graph:
"""

ghenv.Component.Name = "Constant Time Series (Alpaca4d)"
ghenv.Component.NickName = 'CTS'
ghenv.Component.Message = "Constant Time Series (Alpaca4d)"


import sys
import Rhino.Geometry as rg
import Grasshopper as gh
import copy
import math


## add alpaca install directory to system path

ghcompfolder = gh.Folders.DefaultAssemblyFolder
if ghcompfolder not in sys.path:
    sys.path.append(ghcompfolder)

try:
    from Alpaca4d import alpaca4d as alpaca
except:
    msg = "Cannot import Alpaca4d. Is the Alpaca4d folder available in " + ghcompfolder + "?"
    ghenv.Component.AddRuntimeMessage(gh.Kernel.GH_RuntimeMessageLevel.Error, msg)

def ConstantSeries(x):
    return x



checkData = True

if not constantFactor:
    constantFactor = 1


if checkData:
    TimeSeries = alpaca.TimeSeriesConstant(constantFactor)
    
    Graph = []
    
    for x in range(10):
        Graph.append(ConstantSeries(constantFactor))
# ---------- end cts ----------
gl = GravityLoadAlpaca4d(GravityFactor=1, TimeSeries=lts.TimeSeries)  # -> out, Load
# ---------- gl: Python ----------
"""
Create Gravity Load
-
    Args:
        Pos:
        Force:
        Moment:
        TimeSeries:
    Returns:
        PointLoad:
"""

ghenv.Component.Name = "Gravity Load (Alpaca4d)"
ghenv.Component.NickName = 'GL'
ghenv.Component.Message = "Gravity Load (Alpaca4d)"



import sys
import Rhino.Geometry as rg
import Grasshopper as gh
import copy


## add alpaca install directory to system path

ghcompfolder = gh.Folders.DefaultAssemblyFolder
if ghcompfolder not in sys.path:
    sys.path.append(ghcompfolder)

try:
    from Alpaca4d import alpaca4d as alpaca
except:
    msg = "Cannot import Alpaca4d. Is the Alpaca4d folder available in " + ghcompfolder + "?"
    ghenv.Component.AddRuntimeMessage(gh.Kernel.GH_RuntimeMessageLevel.Error, msg)

if not TimeSeries:
    TimeSeries = alpaca.TimeSeriesConstant(1)

Load = alpaca.GravityLoad(GravityFactor, TimeSeries)
# ---------- end gl ----------

# ----
ssp = SSPBrickAlpaca4d(Brick=mstb, nDMaterial=eim.nDMaterial)  # -> out, Element; inputs Brick: Mesh, Colour: Color
# ---------- ssp: Python ----------
"""
Create a Stabilized Single Point Brick (SSPbrick)
-
    Args:
        Brick:
        nDMaterial:
        Colour:
    Returns:
        element:
"""

ghenv.Component.Name = "SSP brick (Alpaca4d)"
ghenv.Component.NickName = 'SSP'
ghenv.Component.Message = "SSP brick (Alpaca4d)"


import sys
import Rhino.Geometry as rg
import Grasshopper as gh
import copy
from System.Drawing import Color

## add alpaca install directory to system path

ghcompfolder = gh.Folders.DefaultAssemblyFolder
if ghcompfolder not in sys.path:
    sys.path.append(ghcompfolder)

try:
    from Alpaca4d import alpaca4d as alpaca
    from Alpaca4d import alpaca4dUtil as alpacaUtil
except:
    msg = "Cannot import Alpaca4d. Is the Alpaca4d folder available in " + ghcompfolder + "?"
    ghenv.Component.AddRuntimeMessage(gh.Kernel.GH_RuntimeMessageLevel.Error, msg)


checkData = True

if not Brick:
    checkData = False
    msg = "Input parameter Brick failed to collect data"
    ghenv.Component.AddRuntimeMessage(gh.Kernel.GH_RuntimeMessageLevel.Warning, msg)

if not nDMaterial:
    checkData = False
    msg = "Input parameter nDMaterial failed to collect data"
    ghenv.Component.AddRuntimeMessage(gh.Kernel.GH_RuntimeMessageLevel.Warning, msg)

if not Colour:
    Colour = Color.OrangeRed


if checkData:
    Brick = alpacaUtil.cleanHexahedron(Brick)
    Element = alpaca.SSPbrick(Brick,copy.deepcopy(nDMaterial), Colour)
# ---------- end ssp ----------
am = AssembleModelAlpaca4d(Element=flatten(ssp.Element), Support=flatten(support), Load=flatten(gl.Load))  # -> out, AlpacaModel, Mass; inputs Element: list, Support: list, Load: list, Constraint: list
# ---------- am: Python ----------
"""
Create a FEA Model
-
    Args:
        Element:
        Support:
        Load:
        Constraint:
    Returns:
        AlpacaModel:
"""


import os
import sys
import ghpythonlib.treehelpers as th
import Rhino.Geometry as rg
import Rhino.Collections as rc
import rhinoscriptsyntax as rs
from collections import defaultdict, OrderedDict
import copy
import time
import Grasshopper as gh


ghenv.Component.Name = "Assemble Model (Alpaca4d)"
ghenv.Component.NickName = 'AM'
ghenv.Component.Message = "Assemble Model (Alpaca4d)"


## add alpaca install directory to system path

ghcompfolder = gh.Folders.DefaultAssemblyFolder
if ghcompfolder not in sys.path:
    sys.path.append(ghcompfolder)

try:
    from Alpaca4d import alpaca4d as alpaca
except:
    msg = "Cannot import Alpaca4d. Is the Alpaca4d folder available in " + ghcompfolder + "?"
    ghenv.Component.AddRuntimeMessage(gh.Kernel.GH_RuntimeMessageLevel.Error, msg)


checkData = True

if not Element:
    checkData = False
    msg = "Input parameter Element failed to collect data"
    ghenv.Component.AddRuntimeMessage(gh.Kernel.GH_RuntimeMessageLevel.Warning, msg)

if not Support:
    checkData = False
    msg = "Input parameter Support failed to collect data"
    ghenv.Component.AddRuntimeMessage(gh.Kernel.GH_RuntimeMessageLevel.Warning, msg)


if checkData:
    
    FolderPath = rs.DocumentPath()
    os.chdir(FolderPath)
    
    # create the object model
    AlpacaModel = alpaca.Model()
    
    
    start = time.clock()
    #subdivide element per type
    
    for element in Element:
        if element.type == "Beam":
            AlpacaModel.beams.append(element)
        elif element.type == "Shell":
            AlpacaModel.shells.append(element)
        elif element.type == "Brick":
            AlpacaModel.bricks.append(element)
    
    end = time.clock() - start
    print("time to subdivide element {}".format(end))
    start = time.clock()
    
    # create a list of unique point
    # need to add the rigid constraint
    
    AlpacaModel.getuniquePoints(AlpacaModel.beams, AlpacaModel.shells, AlpacaModel.bricks, Constraint)
    
    
    end = time.clock() - start
    print("time to get uniquepoints {}".format(end))
    start = time.clock()
    
    
    #############
    # create node and assign to object
    #############
    
    if AlpacaModel.uniquePointsThreeNDF:
        AlpacaModel.py.append(alpaca.Model.write3ndf_tcl())
        for point in AlpacaModel.uniquePointsThreeNDF:
            node = alpaca.Node(point)
            node.ndf = 3
            node.setNodeTag(AlpacaModel)
            AlpacaModel.nodes.append( node )
        
            AlpacaModel.py.append(node.write_tcl())
    
    
    if AlpacaModel.uniquePointsSixNDF:
        AlpacaModel.py.append(alpaca.Model.write6ndf_tcl())
        for point in AlpacaModel.uniquePointsSixNDF:
            node = alpaca.Node(point)
            node.ndf = 6
            node.setNodeTag(AlpacaModel)
            AlpacaModel.nodes.append( node )
         
            AlpacaModel.py.append(node.write_tcl())
    
    
    
    end = time.clock() - start
    print("time to create node and assign tag {}".format(end))
    start = time.clock()
    
    
    #################
    # create supports
    #################
    
    for supportNode in Support:
        
        # if the list is empty, skip this operation
        if AlpacaModel.uniquePointsThreeNDF:
            closestPointInThreeNDF = rc.Point3dList.ClosestPointInList(AlpacaModel.uniquePointsThreeNDF, supportNode.Pos)
            if supportNode.Pos.DistanceTo(closestPointInThreeNDF) < 0.001:
                #print("I am in 3ndf")
                supportNode.ndf = 3
                AlpacaModel.threeNDFModel.append(supportNode)
                supportNode.setNodeTag(AlpacaModel)
        
        if AlpacaModel.uniquePointsSixNDF:
            closestPointInSixNDF = rc.Point3dList.ClosestPointInList(AlpacaModel.uniquePointsSixNDF, supportNode.Pos)
            if supportNode.Pos.DistanceTo(closestPointInSixNDF) < 0.001:
                supportNode.ndf = 6
                AlpacaModel.sixNDFModel.append(supportNode)
                supportNode.setNodeTag(AlpacaModel)
        
        
        AlpacaModel.supports.append(supportNode)
        AlpacaModel.py.append(supportNode.write_tcl())
    
    
    end = time.clock() - start
    print("time to create support and assign tag {}".format(end))
    start = time.clock()
    
    
    ####################
    # create constraints
    ####################
    
    
    for constraint in Constraint:
        constraint.setNodeTag(AlpacaModel)
        AlpacaModel.constraints.append(constraint)
    
    ####################
    # create equalDOF when the model has 3df and 6df together
    ####################
    
    
    end = time.clock() - start
    print("time to create constraint and assign tag {}".format(end))
    start = time.clock()
    
    
    Id = []
    IdB = []
    
    def SearchCallback(sender, e):
        Id.Add(e.Id)
        IdB.Add(e.IdB)
    
    
    
    lenThreeNDF = len(AlpacaModel.uniquePointsThreeNDF)
    lenSixNDF = len(AlpacaModel.uniquePointsSixNDF)
    
    
    if not(lenThreeNDF == 0 or lenSixNDF == 0):
        print("brick and beam together")
        rg.RTree.SearchOverlaps(AlpacaModel.RTreeCloudPointThreeNDF, AlpacaModel.RTreeCloudPointSixNDF, 0.001, SearchCallback)
        
        for i,j in zip(Id, IdB):
            print(i,j)
            node_i = AlpacaModel.uniquePointsThreeNDF[i]
            node_j = AlpacaModel.uniquePointsSixNDF[j]
            
            #index_i = AlpacaModel.cloudPoint.ClosestPoint(node_i) + 1
            #index_j = AlpacaModel.cloudPoint.ClosestPoint(node_j) + 1
            
            equalConstraint = alpaca.EqualDOF(node_i, node_j, True, True, True, False, False, False)
            equalConstraint.masterNodeTag = AlpacaModel.cloudPointThreeNDF.ClosestPoint(node_i) + 1
            equalConstraint.slaveNodesTag = AlpacaModel.cloudPointSixNDF.ClosestPoint(node_j) + 1 + len(AlpacaModel.uniquePointsThreeNDF)
            AlpacaModel.py.append(equalConstraint.write_tcl())
    
    
    
    end = time.clock() - start
    print("time to find common points between 3ndf and 6ndf {}".format(end))
    start = time.clock()
    
    
    # write py file
    
    
    # assign tag and node Index to element and shell
    for index, element in enumerate(Element,1):
        element.setTopologyRTree(AlpacaModel)
        element.eleTag = index
        element.setTags()
    
    
    
    end = time.clock() - start
    print("time to assign tags for the elements {}".format(end))
    start = time.clock()
    
    
    
    Mass = 0
    IsGravity = False
    
    for item in Load:
        if item.type == "Gravity Load":
            IsGravity = True
            GravityLoad = item
        if item.type == "PointLoad":
            AlpacaModel.loads.append(item)
    
    
    for item in Element:
        if item.type == "Beam":
            length = item.Crv.GetLength()
            Mass += (item.massDens * length)
            if IsGravity:
                gravityPointLoad = alpaca.PointLoad(item.Crv.PointAtStart, rg.Vector3d(0,0, -(item.massDens * length / 2)) * GravityLoad.GravityFactor, rg.Vector3d(0,0,0), GravityLoad.TimeSeries)
                #print( -(item.massDens * length / 2))
                AlpacaModel.loads.append(gravityPointLoad)
        if item.type == "Shell":
            meshArea = rg.AreaMassProperties.Compute(item.Mesh).Area
            areaDensity = item.CrossSection.thickness * item.CrossSection.material.rho
            Mass += areaDensity * meshArea
            if IsGravity:
                for vertex in item.Mesh.Vertices.ToPoint3dArray():
                    gravityPointLoad = alpaca.PointLoad(vertex, rg.Vector3d(0,0, -(areaDensity * meshArea/ len(item.Mesh.Vertices))) * GravityLoad.GravityFactor, rg.Vector3d(0,0,0), GravityLoad.TimeSeries)
                    AlpacaModel.loads.append(gravityPointLoad)
        if item.type == "Brick":
            #print(type(item.Mesh))
            meshVolume = rg.VolumeMassProperties.Compute(item.Mesh).Volume
            density = item.material.rho 
            Mass += density * meshVolume
            if IsGravity:
                for vertex in item.Mesh.Vertices.ToPoint3dArray():
                    gravityPointLoad = alpaca.PointLoad(vertex, rg.Vector3d(0,0, -(density * meshVolume / len(item.Mesh.Vertices))) * GravityLoad.GravityFactor, rg.Vector3d(0,0,0), GravityLoad.TimeSeries)
                    #print(len(item.Mesh.Vertices))
                    #print(density)
                    # volume can be zero if mesh faces are not properly rotated
                    #print(meshVolume)
                    #print(-(density * meshVolume / len(item.Mesh.Vertices)))
                    AlpacaModel.loads.append(gravityPointLoad)
    
    #print(AlpacaModel.loads)
    ## load
    
    
    for item in AlpacaModel.loads:
        item.setNodeTag(AlpacaModel)
    
    #print(AlpacaModel.loads)
    
    for item in AlpacaModel.beams:
        AlpacaModel.py.append(item.write_tcl())
    
    for item in AlpacaModel.shells:
        AlpacaModel.py.append(item.write_tcl())
    
    for item in AlpacaModel.bricks:
        AlpacaModel.py.append(item.write_tcl())
    
    
    for item in Constraint:
        AlpacaModel.py.append(item.write_tcl())
    
    
    timeSeriesDict = alpaca.TimeSeries.getTimeSeries(AlpacaModel.loads)[1]
    AlpacaModel.py.append(alpaca.PointLoad.write_tcl(timeSeriesDict,AlpacaModel))
# ---------- end am ----------
as = AnalysisSettingsAlpaca4d(AnalysisSteps="1")  # -> Settings
# ---------- as: Python ----------
"""
Create Analysis settings
-
    Args:
        Constraint: 'Plain', 'Transformation'. Default is 'Transformation'.
        Numberer: 'RCM', 'AMD', 'Plain'. Default is 'RCM'.
        System: 'BandGen', 'BandSPD', 'ProfileSPD', 'SuperLU', 'UmfPack', 'FullGeneral', 'SparseSYM'. Default is 'BandSPD'.
        Test: Feature not implemented. Please contact alpaca4d@gmail.com 
        Algorithm: 'Linear', 'Newton', 'NewtonLineSearch', 'ModifiedNewton', 'KrylovNewton', 'SecantNewton', 'BFGS', 'Broyden'. Default is 'Linear'.
        Integrator: Default is LoadControl.
        AnalysisType: 'Static', 'Transient'. Default is 'Static'.
        AnalyesSteps:
    Returns:
        Analysis:
"""

import sys
import os


import clr
import clrtype
import Rhino.Geometry as rg
import rhinoscriptsyntax as rs
import Grasshopper as gh
import copy
import ghpythonlib.treehelpers as th


ghenv.Component.Name = "Analysis settings (Alpaca4d)"
ghenv.Component.NickName = 'AS'
ghenv.Component.Message = "Analysis settings \n(Alpaca4d)"



from Alpaca4d import alpaca4d as alpaca

checkData = True


# default Value
Constraint = 'Transformation' if Constraint is None else Constraint
ConstraintList = ['Plain', 'Transformation']

for item in ConstraintList:
    if Constraint.lower() == item.lower():
        print(item)
        Constraint = item


# default Value
Numberer = 'RCM' if Numberer is None else Numberer
NumbererList = ['RCM', 'AMD', 'Plain', 'ParallelPlain', 'ParallelRCM']

for i,item in enumerate(NumbererList):
    if Numberer.lower() == item.lower():
        Numberer = item



# default Value
System = 'BandSPD' if System is None else System
SystemList = ['BandGen', 'BandSPD', 'ProfileSPD', 'SuperLU', 'UmfPack', 'FullGeneral', 'SparseSYM']

for i,item in enumerate(SystemList):
    if System.lower() == item.lower():
        System = item


# default Test
Test = 'NormDispIncr 1.0e-6 12 5' if Test is None else Test




# default Value
Algorithm = 'Linear' if Algorithm is None else Algorithm
AlgorithmList = ['Linear', 'Newton', 'NewtonLineSearch', 'ModifiedNewton', 'KrylovNewton', 'SecantNewton', 'BFGS', 'Broyden']

for i,item in enumerate(AlgorithmList):
    if Algorithm.lower() == item.lower():
        Algorithm = item


# default Value
AnalysisType = 'Static' if AnalysisType is None else AnalysisType
AnalysisTypeList = ['Static', 'Transient']

for item in AnalysisTypeList:
    if AnalysisType.lower() == item.lower():
        AnalysisType = item


## Define Integrator
if AnalysisType == "Static":
    Integrator = "LoadControl 1.0" if Integrator is None else Integrator
elif AnalysisType == "Transien":
    Integrator = "Newmark 0.5 0.25" if Integrator is None else Integrator



if not AnalysisSteps:
    checkData = False
    msg = "Input parameter AnalysisSteps failed to collect data"
    ghenv.Component.AddRuntimeMessage(gh.Kernel.GH_RuntimeMessageLevel.Warning, msg)


if checkData:
    Settings = alpaca.Analysis(Constraint, Numberer,System,Test,Algorithm,Integrator,AnalysisType, AnalysisSteps)
    print(Settings.write_tcl())
# ---------- end as ----------
ra = RunAnalysisAlpaca4d(AlpacaModel=am.AlpacaModel, Settings=as)  # -> log, AlpacaSolvedModel
# ---------- ra: Python ----------
"""
Run an OpenSees Analysis
-
    Args:
        AlpacaModel:
        Settings:
    Returns:
        AlpacaSolvedModel:
"""



import Rhino.RhinoDoc
import Grasshopper as gh
import copy
import rhinoscriptsyntax as rs
import os
import time
import sys



ghenv.Component.Name = "Run Analysis (Alpaca4d)"
ghenv.Component.NickName = 'RA'
ghenv.Component.Message = "Run Analysis (Alpaca4d)"

ghcompfolder = gh.Folders.DefaultAssemblyFolder
if ghcompfolder not in sys.path:
    sys.path.append(ghcompfolder)

try:
    from Alpaca4d import alpaca4d as alpaca
except:
    msg = "Cannot import Alpaca4d. Is the Alpaca4d folder available in " + ghcompfolder + "?"
    ghenv.Component.AddRuntimeMessage(gh.Kernel.GH_RuntimeMessageLevel.Error, msg)


checkData = True



if not AlpacaModel:
    checkData = False
    msg = "Input parameter AlpacaModel failed to collect data"
    ghenv.Component.AddRuntimeMessage(gh.Kernel.GH_RuntimeMessageLevel.Warning, msg)


if not Settings:
    checkData = False
    msg = "Input parameter Settings failed to collect data"
    ghenv.Component.AddRuntimeMessage(gh.Kernel.GH_RuntimeMessageLevel.Warning, msg)


if checkData:
    FolderPath = rs.DocumentPath()
    os.chdir(FolderPath)
    
    outputFileName = 'openSeesModel'
    recorderFileName = 'recorder.mpco'
    
    for dirpath, dirnames, filenames in os.walk(FolderPath):
        for filename in filenames:
            if filename == outputFileName:
                file = os.path.join(dirpath,outputFileName)
                os.remove(file)
            elif filename == recorderFileName:
                file = os.path.join(dirpath,recorderFileName)
                os.remove(file)
    
    
    # create a copy
    
    AnalysisModel = copy.copy(AlpacaModel)
    AnalysisModel.py = list(AnalysisModel.py)
    
    # generate Recorder and assign name
    AnalysisModel.recorderName = "recorder" + ".mpco"
    
    AnalysisModel.py.append(alpaca.TCLRecorder.mpco(AnalysisModel.recorderName, True,True,True,True,False,False,True,True,True,True))
    
    
    AnalysisModel.analysis = Settings
    AnalysisModel.py.append(Settings.write_tcl())
    AnalysisModel.py.append("wipe")
    
    
    #textFile = AnalysisModel.py
    
    time_start = time.clock()
    
    AnalysisModel.writeFile(outputFileName)
    
    time_elapsed = (time.clock() - time_start)
    print("Writing Time {}".format(time_elapsed))
    
    
    
    time_start = time.clock()
    
    executable = os.path.join(ghcompfolder,'Alpaca4d\OpenSees-Solvers\opensees.bat')
    a, log = AnalysisModel.runOpensees(executable)
    
    
    time_elapsed = (time.clock() - time_start)
    print("Analyses Time {}".format(time_elapsed))
    
    AlpacaSolvedModel = copy.copy(AnalysisModel)
    AlpacaSolvedModel.isAnalysed = True
# ---------- end ra ----------
panel = Panel(ra.log)
