# Grasshopper definition 02_Multi_Storey_Building.gh (Grasshopper 1.0.7)
# plug-ins: Kangaroo2 Components, Weaverbird, MeshEdit Components

number_floor = Slider(5, range=2..15)
series = Series(Start=0, Step="5", Count=number_floor)
rectangle = Rectangle(Plane=PlaneXY(0, 0, 0), XSize="40", YSize="20", Radius=0)  # -> Rectangle, Length
Z = UnitZ(Factor=series)
srf = Surface(simplify(rectangle.Rectangle))
span_v = Slider(5, range=1..6)
span_u = Slider(5, range=1..6)

# ---- group: Element
data = Data(0)
data_2 = Data(0)

# ---- group: Load
# instagram:    Alpaca4d
# facebook:     Alpaca4d
# mail:             alpaca4d@gmail.com
# Example Developed by Marco Pellegrino
data_3 = Data(0)
data_4 = Data(0)

# ----
num = Number("40")
num_2 = Number("20")

# ---- group: Cross-Section
data_5 = Data(0)
data_6 = Data(0)

# ---- group: Support
data_7 = Data(0)
data_8 = Data(0)

# ----
division = Division(A=num, B=span_u)
division_2 = Division(A=num_2, B=span_v)

# ---- group: Material
data_9 = Data(0)
data_10 = Data(0)

# ---- group: Constraint
data_11 = Data(0)
data_12 = Data(0)

# ----
mplane = MeshPlane(Boundary=rectangle.Rectangle, WidthCount=division, HeightCount=division_2)  # -> Mesh, Area
medges = MeshEdges(Mesh=mplane.Mesh)  # -> NakedEdges, InteriorEdges, NonManifoldEdges
nv = NakedVertices(Mesh=mplane.Mesh)  # -> ClothedIndex, NakedIndex, ClothedPts, NakedPts
join = JoinCurves(Curves=medges.NakedEdges, Preserve=False)
explode = Explode(Curve=join, Recursive=True)  # -> Segments, Vertices
graft = GraftTree(Tree=nv.ClothedPts, IncludeEmptyLists=True, IncludeNullItems=True)
graft_2 = GraftTree(Tree=nv.NakedPts, IncludeEmptyLists=True, IncludeNullItems=True)
graft_3 = GraftTree(Tree=explode.Segments, IncludeEmptyLists=True, IncludeNullItems=True)
graft_4 = GraftTree(Tree=medges.InteriorEdges, IncludeEmptyLists=True, IncludeNullItems=True)
vec = Vector(Z)
vec_2 = Vector(Z)
vec_3 = Vector(Z)
vec_4 = Vector(Z)

panel = Panel("""10
22""")
faceb = FaceBoundaries(Mesh=mplane.Mesh)
item = ListItem(List=faceb, Index=panel, Wrap=True)
graft_5 = GraftTree(Tree=item, IncludeEmptyLists=True, IncludeNullItems=True)
vec_5 = Vector(Z)
move = Move(Geometry=graft_5, Motion=vec_5)  # -> Geometry, Transform
shift = ShiftList(List=move.Geometry, Shift=1, Wrap=invert(True))
merge = Merge(Data1=simplify(graft(move.Geometry)), Data2=simplify(graft(shift)))
loft = Loft(Curves=merge, Options={Adjust=False, Closed=False, LoftEnds=0, LoftSimp=0, LoftType=0, Rebuild=10, Refit=0.01})
clean = CleanTree(RemoveNulls=True, RemoveInvalid=True, RemoveEmpty=invert(False), Tree=loft)
debrep = DeconstructBrep(Brep=clean)  # -> simplify(Faces), Edges, Vertices

move_2 = Move(Geometry=graft, Motion=vec_2)  # -> Geometry, Transform
move_3 = Move(Geometry=graft_2, Motion=vec_3)  # -> Geometry, Transform
move_4 = Move(Geometry=graft_3, Motion=vec_4)  # -> Geometry, Transform
move_5 = Move(Geometry=graft_4, Motion=vec)  # -> Geometry, Transform
crv = Curve(simplify(move_4.Geometry))
pline = PolyLine(Vertices=move_2.Geometry, Closed=False)
pline_2 = PolyLine(Vertices=move_3.Geometry, Closed=False)
crv_2 = Curve(simplify(move_5.Geometry))
flip = FlipMatrix(Data=crv)
flip_2 = FlipMatrix(Data=crv_2)
join_2 = JoinCurves(Curves=flip_2, Preserve=invert(False))
join_3 = JoinCurves(Curves=flip, Preserve=False)
split = SplitTree(Data=simplify(join_3), Masks=flatten("{>0}"))  # -> Positive, Negative
split_2 = SplitTree(Data=simplify(join_2), Masks=flatten("{>0}"))  # -> Positive, Negative
external_colum = Curve(pline_2)
internal_colum = Curve(pline)
internal_beam = Curve(split_2.Positive)
outer_beam = Curve(split.Positive)

graft_6 = GraftTree(Tree=debrep.Faces, IncludeEmptyLists=True, IncludeNullItems=True)
dim = Dimensions(Surface=graft_6)  # -> UDimension, VDimension
num_3 = Number(dim.UDimension)
num_4 = Number(dim.VDimension)
division_3 = Division(A=num_3, B=Slider(1, range=0.1..1))
division_4 = Division(A=num_4, B=Slider(1, range=0.1..1))
divide = DivideDomain²(Domain=graft_6, UCount=division_3, VCount=division_4)
subsrf = Isotrim(Surface=graft_6, Domain=divide)  # -> simplify(Surface)
smesh = SimpleMesh(Brep=subsrf)  # -> simplify(Mesh)

mjoin = MeshJoin(Meshes=flatten(smesh))
weldvertices = MeshWeldVertices(Mesh=mjoin, Tolerance=0.01)  # -> RuntimeMessage, Mesh

# ----
# Connect if you want to use the mesh element
wbnaked = WeaverbirdsNakedBoundary(MeshClosedPolylines=weldvertices.Mesh)
item_2 = ListItem(List=wbnaked, Index=0, Wrap=True)
explode_2 = Explode(Curve=item_2, Recursive=True)  # -> Segments, Vertices
geo = Geometry([nv.ClothedPts, nv.NakedPts])
merge_2 = Merge(Data1=geo)  # -> flatten(Result)
cullpt = CullDuplicates(Points=merge_2, Tolerance=0.1, CullMode=3)  # -> Points, Indices, Valence

uem = UniaxialElasticMaterialAlpaca4d(E="3.3e+10", G="0.20", rho="2500")  # -> out, uniAxialMaterial
# ---------- uem: Python ----------
"""
Create a uniaxial Elastic Material
-
    Args:
        E:
        Eneg:
        eta:
        G:
        v:
        rho:
    Returns:
        uniAxialMaterial:
"""

ghenv.Component.Name = "uniaxial Elastic Material (Alpaca4d)"
ghenv.Component.NickName = 'UEM'
ghenv.Component.Message = "uniaxial Elastic (Alpaca4d)"

import sys
import Rhino.Geometry as rg
import Grasshopper as gh
import copy


## add alpaca install directory to system path

ghcompfolder = gh.Folders.DefaultAssemblyFolder
if ghcompfolder not in sys.path:
    sys.path.append(ghcompfolder)

try:
    from Alpaca4d import alpaca4d as alpaca
except:
    msg = "Cannot import Alpaca4d. Is the Alpaca4d folder available in " + ghcompfolder + "?"
    ghenv.Component.AddRuntimeMessage(gh.Kernel.GH_RuntimeMessageLevel.Error, msg)


checkData = True

if not E:
    checkData = False
    msg = "Input parameter E failed to collect data"
    ghenv.Component.AddRuntimeMessage(gh.Kernel.GH_RuntimeMessageLevel.Warning, msg)

if not G and not v:
    checkData = False
    msg = "Input parameter G or v failed to collect data"
    ghenv.Component.AddRuntimeMessage(gh.Kernel.GH_RuntimeMessageLevel.Warning, msg)

if not rho:
    checkData = False
    msg = "Input parameter rho failed to collect data"
    ghenv.Component.AddRuntimeMessage(gh.Kernel.GH_RuntimeMessageLevel.Warning, msg)



if checkData:
    uniAxialMaterial = alpaca.uniAxialMaterialElastic(name, E, Eneg, eta, G, v, rho)
# ---------- end uem ----------

crv_3 = Curve([internal_colum, external_colum])
explode_3 = Explode(Curve=crv_3, Recursive=True)  # -> Segments, Vertices
rs = RectangularSectionAlpaca4d(b="0.3", h="0.3", material=uem.uniAxialMaterial)  # -> out, Section
# ---------- rs: Python ----------
"""
Create a Rectangular Cross Section
-
    Args:
        secName:
        Area:
        Izz:
        Iyy:
        J:
        alphaY:
        alphaZ:
        material:
    Returns:
        Section:
"""
ghenv.Component.Name = "Rectangular Section (Alpaca4d)"
ghenv.Component.NickName = 'RS'
ghenv.Component.Message = "Rectangular Section (Alpaca4d)"

import sys
import Rhino.Geometry as rg
import Grasshopper as gh
import copy


## add alpaca install directory to system path

ghcompfolder = gh.Folders.DefaultAssemblyFolder
if ghcompfolder not in sys.path:
    sys.path.append(ghcompfolder)

try:
    from Alpaca4d import alpaca4d as alpaca
except:
    msg = "Cannot import Alpaca4d. Is the Alpaca4d folder available in " + ghcompfolder + "?"
    ghenv.Component.AddRuntimeMessage(gh.Kernel.GH_RuntimeMessageLevel.Error, msg)


checkData = True

if not b:
    checkData = False
    msg = "Input parameter b failed to collect data"
    ghenv.Component.AddRuntimeMessage(gh.Kernel.GH_RuntimeMessageLevel.Warning, msg)

if not h:
    checkData = False
    msg = "Input parameter h failed to collect data"
    ghenv.Component.AddRuntimeMessage(gh.Kernel.GH_RuntimeMessageLevel.Warning, msg)

if not material:
    checkData = False
    msg = "Input parameter material failed to collect data"
    ghenv.Component.AddRuntimeMessage(gh.Kernel.GH_RuntimeMessageLevel.Warning, msg)



if checkData:
    rectCS = alpaca.RectangularCS(b,h,material)
    Section = alpaca.ElasticSection(secName, rectCS.Area(), rectCS.Izz(), rectCS.Iyy(), rectCS.J(), rectCS.alphaY, rectCS.alphaZ, rectCS.material)
    Section.crv = rectCS.crv
    Section.sectionBrep = rectCS.sectionBrep
# ---------- end rs ----------
fbc = ForceBeamColumnAlpaca4d(Line=explode_3.Segments, Section=rs.Section)  # -> Element; inputs Line: Curve, Colour: Color, Z_Axis: Vector3d
# ---------- fbc: Python ----------
"""
Create a Force Beam Column
-
    Args:
        Line:
        Section:
        Colour:
        Z_Axis:
    Returns:
        Element:
"""

ghenv.Component.Name = "Force Beam Column (Alpaca4d)"
ghenv.Component.NickName = 'FBC'
ghenv.Component.Message = "Force Beam Column (Alpaca4d)"


import sys
import Rhino.Geometry as rg
import Grasshopper as gh
import ghpythonlib.components as ghcomp
from System.Drawing import Color

## add alpaca install directory to system path

ghcompfolder = gh.Folders.DefaultAssemblyFolder
if ghcompfolder not in sys.path:
    sys.path.append(ghcompfolder)

try:
    from Alpaca4d import alpaca4d as alpaca
except:
    msg = "Cannot import Alpaca4d. Is the Alpaca4d folder available in " + ghcompfolder + "?"
    ghenv.Component.AddRuntimeMessage(gh.Kernel.GH_RuntimeMessageLevel.Error, msg)


checkData = True

if not Line:
    checkData = False
    msg = "Input parameter Line failed to collect data"
    ghenv.Component.AddRuntimeMessage(gh.Kernel.GH_RuntimeMessageLevel.Warning, msg)


if not Section:
    checkData = False
    msg = "Input parameter Section failed to collect data"
    ghenv.Component.AddRuntimeMessage(gh.Kernel.GH_RuntimeMessageLevel.Warning, msg)

if not Colour:
    Colour = Color.Red


if not GeomTransf:
    GeomTransf = "Linear"

if checkData:
    
    if not Z_Axis:
        midPoint =  Line.PointAtNormalizedLength(0.5)
        parameter = Line.ClosestPoint(midPoint, 0.01)[1]
        Z_Axis = ghcomp.PerpFrame( Line, parameter )
    Element = alpaca.ForceBeamColumn(Line, Section, GeomTransf, Colour, Z_Axis)
# ---------- end fbc ----------

crv_4 = Curve([internal_beam, outer_beam])
explode_4 = Explode(Curve=crv_4, Recursive=True)  # -> Segments, Vertices
rs_2 = RectangularSectionAlpaca4d(b="0.6", h="0.3", material=uem.uniAxialMaterial)  # -> out, Section; same code as rs
fbc_2 = ForceBeamColumnAlpaca4d(Line=explode_4.Segments, Section=rs_2.Section)  # -> Element; inputs Line: Curve, Colour: Color, Z_Axis: Vector3d; same code as fbc

pt = Point(flatten(explode_4.Vertices))
cullpt_2 = CullDuplicates(Points=pt, Tolerance=0.1, CullMode=3)  # -> Points, Indices, Valence

pt_2 = Point(cullpt_2.Points)
cts = ConstantTimeSeriesAlpaca4d()  # -> TimeSeries, Graph
# ---------- cts: Python ----------
"""
Create a Constant Time Series
-
    Args:
        tStart:
        tEnd:
        period:
        factor:
        shift:
    Returns:
        TimeSeries:
        Graph:
"""

ghenv.Component.Name = "Constant Time Series (Alpaca4d)"
ghenv.Component.NickName = 'CTS'
ghenv.Component.Message = "Constant Time Series (Alpaca4d)"


import sys
import Rhino.Geometry as rg
import Grasshopper as gh
import copy
import math


## add alpaca install directory to system path

ghcompfolder = gh.Folders.DefaultAssemblyFolder
if ghcompfolder not in sys.path:
    sys.path.append(ghcompfolder)

try:
    from Alpaca4d import alpaca4d as alpaca
except:
    msg = "Cannot import Alpaca4d. Is the Alpaca4d folder available in " + ghcompfolder + "?"
    ghenv.Component.AddRuntimeMessage(gh.Kernel.GH_RuntimeMessageLevel.Error, msg)

def ConstantSeries(x):
    return x



checkData = True

if not constantFactor:
    constantFactor = 1


if checkData:
    TimeSeries = alpaca.TimeSeriesConstant(constantFactor)
    
    Graph = []
    
    for x in range(10):
        Graph.append(ConstantSeries(constantFactor))
# ---------- end cts ----------
vec_6 = VectorXYZ(XComponent="10000", YComponent=0, ZComponent=0)  # -> Vector, Length
pl = PointLoadAlpaca4d(Pos=pt_2, Force=vec_6.Vector, TimeSeries=cts.TimeSeries)  # -> Load; inputs Pos: Point3d, Force: Vector3d, Moment: Vector3d
# ---------- pl: Python ----------
"""
Create a Point Load
-
    Args:
        Pos:
        Force:
        Moment:
        TimeSeries:
    Returns:
        PointLoad:
"""

ghenv.Component.Name = "Point Load (Alpaca4d)"
ghenv.Component.NickName = 'PL'
ghenv.Component.Message = "Point Load (Alpaca4d)"



import sys
import Rhino.Geometry as rg
import Grasshopper as gh
import copy


## add alpaca install directory to system path

ghcompfolder = gh.Folders.DefaultAssemblyFolder
if ghcompfolder not in sys.path:
    sys.path.append(ghcompfolder)

try:
    from Alpaca4d import alpaca4d as alpaca
except:
    msg = "Cannot import Alpaca4d. Is the Alpaca4d folder available in " + ghcompfolder + "?"
    ghenv.Component.AddRuntimeMessage(gh.Kernel.GH_RuntimeMessageLevel.Error, msg)


checkData = True

if not Pos:
    checkData = False
    msg = "Input parameter Pos failed to collect data"
    ghenv.Component.AddRuntimeMessage(gh.Kernel.GH_RuntimeMessageLevel.Warning, msg)

if not Force:
    Force = rg.Vector3d(0,0,0)

if not Moment:
    Moment = rg.Vector3d(0,0,0)

if not TimeSeries:
    checkData = False
    msg = "Input parameter TimeSeries failed to collect data"
    ghenv.Component.AddRuntimeMessage(gh.Kernel.GH_RuntimeMessageLevel.Warning, msg)


if checkData:
    Load = alpaca.PointLoad(Pos, Force, Moment, TimeSeries)
# ---------- end pl ----------

pt_3 = Point(cullpt.Points)
toggle = BooleanToggle(True)
support = SupportAlpaca4d(Pos=pt_3, Tx=toggle, Ty=toggle, Tz=toggle, Rx=toggle, Ry=toggle, Rz=toggle)  # -> Support; inputs Pos: Point3d, Tx: Boolean, Ty: Boolean, Tz: Boolean, Rx: Boolean, Ry: Boolean, Rz: Boolean
# ---------- support: Python ----------
"""
Create a support
-
    Args:
        Pos:
        Tx:
        Ty:
        Tz:
        Rx:
        Ry:
    Returns:
        Support:
"""

ghenv.Component.Name = "Support (Alpaca4d)"
ghenv.Component.NickName = 'Support'
ghenv.Component.Message = "Support (Alpaca4d)"


import sys
import Rhino.Geometry as rg
import Grasshopper as gh


## add alpaca install directory to system path

ghcompfolder = gh.Folders.DefaultAssemblyFolder
if ghcompfolder not in sys.path:
    sys.path.append(ghcompfolder)

try:
    from Alpaca4d import alpaca4d as alpaca
except:
    msg = "Cannot import Alpaca4d. Is the Alpaca4d folder available in " + ghcompfolder + "?"
    ghenv.Component.AddRuntimeMessage(gh.Kernel.GH_RuntimeMessageLevel.Error, msg)

checkData = True


if not Pos:
    checkData = False
    msg = "Input parameter Pos failed to collect data"
    ghenv.Component.AddRuntimeMessage(gh.Kernel.GH_RuntimeMessageLevel.Warning, msg)

if checkData:
    Support = alpaca.Support(Pos, Tx, Ty, Tz, Rx, Ry, Rz)
# ---------- end support ----------

am = AssembleModelAlpaca4d(Element=flatten([fbc, fbc_2]), Support=flatten(support), Load=flatten(pl))  # -> out, AlpacaModel, Mass; inputs Element: list, Support: list, Load: list, Constraint: list
# ---------- am: Python ----------
"""
Create a FEA Model
-
    Args:
        Element:
        Support:
        Load:
        Constraint:
    Returns:
        AlpacaModel:
"""


import os
import sys
import ghpythonlib.treehelpers as th
import Rhino.Geometry as rg
import Rhino.Collections as rc
import rhinoscriptsyntax as rs
from collections import defaultdict, OrderedDict
import copy
import time
import Grasshopper as gh


ghenv.Component.Name = "Assemble Model (Alpaca4d)"
ghenv.Component.NickName = 'AM'
ghenv.Component.Message = "Assemble Model (Alpaca4d)"


## add alpaca install directory to system path

ghcompfolder = gh.Folders.DefaultAssemblyFolder
if ghcompfolder not in sys.path:
    sys.path.append(ghcompfolder)

try:
    from Alpaca4d import alpaca4d as alpaca
except:
    msg = "Cannot import Alpaca4d. Is the Alpaca4d folder available in " + ghcompfolder + "?"
    ghenv.Component.AddRuntimeMessage(gh.Kernel.GH_RuntimeMessageLevel.Error, msg)


checkData = True

if not Element:
    checkData = False
    msg = "Input parameter Element failed to collect data"
    ghenv.Component.AddRuntimeMessage(gh.Kernel.GH_RuntimeMessageLevel.Warning, msg)

if not Support:
    checkData = False
    msg = "Input parameter Support failed to collect data"
    ghenv.Component.AddRuntimeMessage(gh.Kernel.GH_RuntimeMessageLevel.Warning, msg)


if checkData:
    
    FolderPath = rs.DocumentPath()
    os.chdir(FolderPath)
    
    # create the object model
    AlpacaModel = alpaca.Model()
    
    
    start = time.clock()
    #subdivide element per type
    
    for element in Element:
        if element.type == "Beam":
            AlpacaModel.beams.append(element)
        elif element.type == "Shell":
            AlpacaModel.shells.append(element)
        elif element.type == "Brick":
            AlpacaModel.bricks.append(element)
    
    
    end = time.clock() - start
    print("time to subdivide element {}".format(end))
    start = time.clock()
    
    # create a list of unique point
    # need to add the rigid constraint
    
    AlpacaModel.getuniquePoints(AlpacaModel.beams, AlpacaModel.shells, AlpacaModel.bricks, Constraint)
    
    
    end = time.clock() - start
    print("time to get uniquepoints {}".format(end))
    start = time.clock()
    
    
    #############
    # create node and assign to object
    #############
    
    if AlpacaModel.uniquePointsThreeNDF:
        AlpacaModel.py.append(alpaca.Model.write3ndf_tcl())
        for point in AlpacaModel.uniquePointsThreeNDF:
            node = alpaca.Node(point)
            node.ndf = 3
            node.setNodeTag(AlpacaModel)
            AlpacaModel.nodes.append( node )
        
            AlpacaModel.py.append(node.write_tcl())
    
    
    if AlpacaModel.uniquePointsSixNDF:
        AlpacaModel.py.append(alpaca.Model.write6ndf_tcl())
        for point in AlpacaModel.uniquePointsSixNDF:
            node = alpaca.Node(point)
            node.ndf = 6
            node.setNodeTag(AlpacaModel)
            AlpacaModel.nodes.append( node )
         
            AlpacaModel.py.append(node.write_tcl())
    
    
    
    end = time.clock() - start
    print("time to create node and assign tag {}".format(end))
    start = time.clock()
    
    
    #################
    # create supports
    #################
    
    for supportNode in Support:
        
        # if the list is empty, skip this operation
        if AlpacaModel.uniquePointsThreeNDF:
            closestPointInThreeNDF = rc.Point3dList.ClosestPointInList(AlpacaModel.uniquePointsThreeNDF, supportNode.Pos)
            if supportNode.Pos.DistanceTo(closestPointInThreeNDF) < 0.001:
                #print("I am in 3ndf")
                supportNode.ndf = 3
                AlpacaModel.threeNDFModel.append(supportNode)
                supportNode.setNodeTag(AlpacaModel)
        
        if AlpacaModel.uniquePointsSixNDF:
            closestPointInSixNDF = rc.Point3dList.ClosestPointInList(AlpacaModel.uniquePointsSixNDF, supportNode.Pos)
            if supportNode.Pos.DistanceTo(closestPointInSixNDF) < 0.001:
                supportNode.ndf = 6
                AlpacaModel.sixNDFModel.append(supportNode)
                supportNode.setNodeTag(AlpacaModel)
        
        
        AlpacaModel.supports.append(supportNode)
        AlpacaModel.py.append(supportNode.write_tcl())
    
    
    end = time.clock() - start
    print("time to create support and assign tag {}".format(end))
    start = time.clock()
    
    
    ####################
    # create constraints
    ####################
    
    
    for constraint in Constraint:
        constraint.setNodeTag(AlpacaModel)
        AlpacaModel.constraints.append(constraint)
    
    ####################
    # create equalDOF when the model has 3df and 6df together
    ####################
    
    
    end = time.clock() - start
    print("time to create constraint and assign tag {}".format(end))
    start = time.clock()
    
    
    Id = []
    IdB = []
    
    def SearchCallback(sender, e):
        Id.Add(e.Id)
        IdB.Add(e.IdB)
    
    
    
    lenThreeNDF = len(AlpacaModel.uniquePointsThreeNDF)
    lenSixNDF = len(AlpacaModel.uniquePointsSixNDF)
    
    
    if not(lenThreeNDF == 0 or lenSixNDF == 0):
        print("brick and beam together")
        rg.RTree.SearchOverlaps(AlpacaModel.RTreeCloudPointThreeNDF, AlpacaModel.RTreeCloudPointSixNDF, 0.001, SearchCallback)
        
        for i,j in zip(Id, IdB):
            print(i,j)
            node_i = AlpacaModel.uniquePointsThreeNDF[i]
            node_j = AlpacaModel.uniquePointsSixNDF[j]
            
            #index_i = AlpacaModel.cloudPoint.ClosestPoint(node_i) + 1
            #index_j = AlpacaModel.cloudPoint.ClosestPoint(node_j) + 1
            
            equalConstraint = alpaca.EqualDOF(node_i, node_j, True, True, True, False, False, False)
            equalConstraint.masterNodeTag = AlpacaModel.cloudPointThreeNDF.ClosestPoint(node_i) + 1
            equalConstraint.slaveNodesTag = AlpacaModel.cloudPointSixNDF.ClosestPoint(node_j) + 1 + len(AlpacaModel.uniquePointsThreeNDF)
            AlpacaModel.py.append(equalConstraint.write_tcl())
    
    
    
    end = time.clock() - start
    print("time to find common points between 3ndf and 6ndf {}".format(end))
    start = time.clock()
    
    ##########################
    ##########################
    ##########################
    
    crossSection = []
    material = []
    
    for item in Element:
        crossSection.append(item.CrossSection)
        material.append(item.CrossSection.material)
    
    uniqueCS = list(set(crossSection))
    uniqueMaterial = list(set(material))
    
    for index, material in enumerate(uniqueMaterial,1):
        material.matTag = index
        AlpacaModel.py.append(material.write_tcl())
    
    
    for index, section in enumerate(uniqueCS,1):
        section.sectionTag = index
        AlpacaModel.py.append(section.write_tcl())
        
    
    
    
    
    
    # write py file
    
    
    # assign tag and node Index to element and shell
    for index, element in enumerate(Element,1):
        element.setTopologyRTree(AlpacaModel)
        element.eleTag = index
        element.setTags()
    
    
    
    end = time.clock() - start
    print("time to assign tags for the elements {}".format(end))
    start = time.clock()
    
    
    
    Mass = 0
    IsGravity = False
    
    for item in Load:
        if item.type == "Gravity Load":
            IsGravity = True
            GravityLoad = item
        if item.type == "PointLoad":
            AlpacaModel.loads.append(item)
    
    
    for item in Element:
        if item.type == "Beam":
            length = item.Crv.GetLength()
            Mass += (item.massDens * length)
            if IsGravity:
                gravityPointLoad = alpaca.PointLoad(item.Crv.PointAtStart, rg.Vector3d(0,0, -(item.massDens * length / 2)) * GravityLoad.GravityFactor, rg.Vector3d(0,0,0), GravityLoad.TimeSeries)
                #print( -(item.massDens * length / 2))
                AlpacaModel.loads.append(gravityPointLoad)
        if item.type == "Shell":
            meshArea = rg.AreaMassProperties.Compute(item.Mesh).Area
            areaDensity = item.CrossSection.thickness * item.CrossSection.material.rho
            Mass += areaDensity * meshArea
            if IsGravity:
                for vertex in item.Mesh.Vertices.ToPoint3dArray():
                    gravityPointLoad = alpaca.PointLoad(vertex, rg.Vector3d(0,0, -(areaDensity * meshArea/ len(item.Mesh.Vertices))) * GravityLoad.GravityFactor, rg.Vector3d(0,0,0), GravityLoad.TimeSeries)
                    AlpacaModel.loads.append(gravityPointLoad)
        if item.type == "Brick":
            #print(type(item.Mesh))
            meshVolume = rg.VolumeMassProperties.Compute(item.Mesh).Volume
            density = item.material.rho 
            Mass += density * meshVolume
            if IsGravity:
                for vertex in item.Mesh.Vertices.ToPoint3dArray():
                    gravityPointLoad = alpaca.PointLoad(vertex, rg.Vector3d(0,0, -(density * meshVolume / len(item.Mesh.Vertices))) * GravityLoad.GravityFactor, rg.Vector3d(0,0,0), GravityLoad.TimeSeries)
                    #print(len(item.Mesh.Vertices))
                    #print(density)
                    # volume can be zero if mesh faces are not properly rotated
                    #print(meshVolume)
                    #print(-(density * meshVolume / len(item.Mesh.Vertices)))
                    AlpacaModel.loads.append(gravityPointLoad)
    
    #print(AlpacaModel.loads)
    ## load
    
    
    for item in AlpacaModel.loads:
        item.setNodeTag(AlpacaModel)
    
    #print(AlpacaModel.loads)
    
    for item in AlpacaModel.beams:
        AlpacaModel.py.append(item.write_tcl())
    
    for item in AlpacaModel.shells:
        AlpacaModel.py.append(item.write_tcl())
    
    for item in AlpacaModel.bricks:
        AlpacaModel.py.append(item.write_tcl())
    
    
    for item in Constraint:
        AlpacaModel.py.append(item.write_tcl())
    
    
    timeSeriesDict = alpaca.TimeSeries.getTimeSeries(AlpacaModel.loads)[1]
    AlpacaModel.py.append(alpaca.PointLoad.write_tcl(timeSeriesDict,AlpacaModel))
    
    
    text = AlpacaModel.py
# ---------- end am ----------
vm = ViewModelAlpaca4d(AlpacaModel=am.AlpacaModel, type=Toggle(False), localAxis=Toggle(False), support=Toggle(True), load=Toggle(False))  # inputs type: Boolean, nodeTag: Boolean, eleTag: Boolean, localAxis: Boolean, support: Boolean, load: Boolean
# ---------- vm: Python ----------
"""View structural Model
    Inputs:
        AlpacaModel: Output of Assemble Model.
        type: Style of visualize Model 
Default: Visualize the stick Model
True: Visualize the extrude Model
        nodeTag: 
True: Visualize tag nodes
        eleTag: 
True: Visualize tag elements 
        LocalAxes:
True: Visualize local Axis of elements 
        Support: 
True: Visualize support type
        Load: 
True: Visualize load
"""


from ghpythonlib.componentbase import executingcomponent as component
import Grasshopper, GhPython
import System
import ghpythonlib.components as ghcomp

import Rhino as rc
import rhinoscriptsyntax as rs
import sys
import Rhino.Geometry as rg
import Grasshopper as gh
import copy

ghenv.Component.Name = "View Model (Alpaca4d)"
ghenv.Component.NickName = 'VM'
ghenv.Component.Message = "View Model (Alpaca4d)"

ghcompfolder = gh.Folders.DefaultAssemblyFolder
if ghcompfolder not in sys.path:
    sys.path.append(ghcompfolder)
try:
    from Alpaca4d import alpaca4dView as alpacaView
except:
    msg = "Cannot import Alpaca4d. Is the Alpaca4d folder available in " + ghcompfolder + "?"
    ghenv.Component.AddRuntimeMessage(gh.Kernel.GH_RuntimeMessageLevel.Error, msg)

checkData = True

class MyComponent(component):
    
    def RunScript(self, AlpacaModel, type, nodeTag, eleTag, localAxis, support, load):
        
        
        self.ModelBeam = []
        self.ModelShell = []
        self.ModelBrick = []
        self.Nodes = []
        self.TagEle = []
        self.localAxis = []
        self.solidSupport = []
        self.viewLoad = []
        
        if not AlpacaModel:
            checkData = False
            msg = "Input parameter AlpacaModel failed to collect data"
            ghenv.Component.AddRuntimeMessage(gh.Kernel.GH_RuntimeMessageLevel.Warning, msg)
        else:
            self.type = type
            
            ## add alpaca install directory to system path
            
            self.ModelBeam = alpacaView.ViewBeam( AlpacaModel, type)
            self.ModelShell = alpacaView.ViewShell( AlpacaModel, type )
            self.ModelBrick = alpacaView.ViewBrick( AlpacaModel)
            #NODE TAG VIEW
            if nodeTag is True:
                self.Nodes = [ [inode.nodeTag, inode.Pos] for inode in AlpacaModel.nodes]
            else:
                self.Nodes = []
            #ELE TAG VIEW
            if eleTag is True:
                TagBeam = [ [item.eleTag, item.getPerpFrame().Origin] for item in AlpacaModel.beams]
                TagShell = [ [item.eleTag, rg.AreaMassProperties.Compute( item.Mesh, False, True, False, False ).Centroid] for item in AlpacaModel.shells]
                TagBrick = [ [item.eleTag, rg.AreaMassProperties.Compute( item.Mesh, False, True, False, False ).Centroid] for item in AlpacaModel.bricks]
                self.TagEle = TagBeam + TagShell + TagBrick
            else:
                self.TagEle = []
            #LOCAL AXIS
            if localAxis is True:
                self.localAxis = [ [item.getPerpFrame().Origin, item.getPerpFrame().XAxis, item.getPerpFrame().YAxis, item.getPerpFrame().ZAxis]   for item in AlpacaModel.beams]
    
                for item in AlpacaModel.shells:
                    item.Mesh.Normals.ComputeNormals()
                    i = item.Mesh.Vertices[0]
                    j = item.Mesh.Vertices[1]
                    curve = rg.LineCurve( i, j )
                    midPoint = rg.AreaMassProperties.Compute( item.Mesh, False, True, False, False ).Centroid
                    vector3 = item.Mesh.Normals.Item[0]
                    vector1 = rg.Curve.PerpendicularFrameAt( curve, 0 )[1].ZAxis
                    vector2 = rg.Vector3d.CrossProduct( vector3, vector1)
                    self.localAxis.append( [midPoint, ghcomp.UnitVector(vector1), ghcomp.UnitVector(vector2), ghcomp.UnitVector(vector3)] )
                
                for item in AlpacaModel.bricks:
                    FaceNormals = ghcomp.FaceNormals(item.Mesh)
                    midPoint = FaceNormals[0]
                    normals = FaceNormals[1]
                    face = item.Mesh.Faces
                    curve = []
                    for iFace in face:
                        i = item.Mesh.Vertices[iFace[0]]
                        j = item.Mesh.Vertices[iFace[1]]
                        curve.append( rg.LineCurve( i, j ) )
                    for iM, iN, iC in zip(midPoint, normals, curve):
                        vector3 = iN
                        vector1 = rg.Curve.PerpendicularFrameAt( iC, 0 )[1].ZAxis
                        vector2 = rg.Vector3d.CrossProduct( vector3, vector1)
                        self.localAxis.append( [iM, ghcomp.UnitVector(vector1), ghcomp.UnitVector(vector2), ghcomp.UnitVector(vector3)] )
                
            else:
                self.localAxis = []
            #SUPPORT
            if support is True:
                scale = 0.5
                self.solidSupport = [ alpacaView.Support( iSupport, scale ) for iSupport in AlpacaModel.supports ]
            else:
                self.solidSupport = []
            # LOAD
            if load is True:
                self.viewLoad =[[item.Pos, item.Force, item.Moment] for item in AlpacaModel.loads]
            else:
                self.viewLoad = []
            self.forceBounds = ghcomp.Bounds([ item[1] for item in self.viewLoad])
            self.momentBounds = ghcomp.Bounds([ item[2] for item in self.viewLoad])

    def DrawViewportWires(self,arg):
        # Beam
        for iBeam in self.ModelBeam:
            color = iBeam[1]
            colorMaterial = rc.Display.DisplayMaterial(color, 0.3)
            if self.type is True:
                colorWirframe = System.Drawing.Color.Gray
                #System.Drawing.Color.LightGray
                arg.Display.DrawBrepShaded(iBeam[0], colorMaterial)
                arg.Display.DrawBrepWires(iBeam[0], colorWirframe)
            else :
                thickness =2
                arg.Display.DrawCurve(iBeam[0], color, thickness)
        # Mesh
        for iShell in self.ModelShell:
            color = iShell[1]
            #color = System.Drawing.Color.Blue
            colorMaterial = rc.Display.DisplayMaterial(color,color,color,color,1,0.30)
            colorMaterial.IsTwoSided = False
            arg.Display.DrawMeshShaded(iShell[0], colorMaterial)
            colorWirframe = System.Drawing.Color.Black
            arg.Display.DrawMeshWires(iShell[0], colorWirframe)
        #Brick 
        for iBrick in self.ModelBrick:
            color = iBrick[1]
            #color = System.Drawing.Color.Blue
            colorMaterial = rc.Display.DisplayMaterial(color,color,color,color,1,0.30)
            colorMaterial.IsTwoSided = False
            arg.Display.DrawMeshShaded(iBrick[0], colorMaterial)
            colorWirframe = System.Drawing.Color.Black
            arg.Display.DrawMeshWires(iBrick[0], colorWirframe)
            
        # node Tag view
        for inode in self.Nodes:
            arg.Display.Draw2dText( str(inode[0]), System.Drawing.Color.DarkSlateBlue, inode[1], True, 50)
        # ele Tag view
        for iEle in self.TagEle:
            arg.Display.Draw2dText( str(iEle[0]), System.Drawing.Color.BlanchedAlmond, iEle[1], True, 50)
        # local Axis
        for iLocalAxis in self.localAxis:
            c = 0.25
            arg.Display.DrawArrow( rg.Line(iLocalAxis[0], rg.Vector3d.Multiply(c,iLocalAxis[1])), System.Drawing.Color.Red)
            arg.Display.DrawArrow( rg.Line(iLocalAxis[0], rg.Vector3d.Multiply(c,iLocalAxis[2])), System.Drawing.Color.Green)
            arg.Display.DrawArrow( rg.Line(iLocalAxis[0], rg.Vector3d.Multiply(c,iLocalAxis[3])), System.Drawing.Color.Blue)
            
            
        color = System.Drawing.Color.Azure
        colorWirframe = System.Drawing.Color.Black
        colorMaterial = rc.Display.DisplayMaterial(color, 0.0)
        for iSupport in self.solidSupport :
            arg.Display.DrawBrepShaded( iSupport, colorMaterial)
            arg.Display.DrawBrepWires( iSupport, colorWirframe)
            
        for iLoad in self.viewLoad:
            arg.Display.DrawArrow( rg.Line(iLoad[0], iLoad[1]/self.forceBounds[1]) ,  System.Drawing.Color.DarkRed)
            arg.Display.DrawArrow( rg.Line(iLoad[0], iLoad[2]/self.momentBounds[1]) ,  System.Drawing.Color.DarkBlue)
# ---------- end vm ----------
as = AnalysesStepsAlpaca4d(numIncr="1")  # -> AnalysisSteps; inputs numIncr: Int32
# ---------- as: Python ----------
"""
Define the Analysis Step
-
    Inputs:
        numIncr:
        dt:
        dtMin:
        dtMAx:
        Jd:
    Output:
        AnalysisSteps:
"""



ghenv.Component.Name = "Analyses Steps (Alpaca4d)"
ghenv.Component.NickName = 'AS'
ghenv.Component.Message = "Analyses Steps (Alpaca4d)"
ghenv.Component.IconDisplayMode = ghenv.Component.IconDisplayMode.application
ghenv.Component.Category = "Alpaca4d"
ghenv.Component.SubCategory = "7_Analysis"



import sys
import Rhino.Geometry as rg
import Grasshopper as gh
import ghpythonlib.components as ghcomp
from System.Drawing import Color

## add alpaca install directory to system path

ghcompfolder = gh.Folders.DefaultAssemblyFolder
if ghcompfolder not in sys.path:
    sys.path.append(ghcompfolder)

try:
    from Alpaca4d import alpaca4d as alpaca
except:
    msg = "Cannot import Alpaca4d. Is the Alpaca4d folder available in " + ghcompfolder + "?"
    ghenv.Component.AddRuntimeMessage(gh.Kernel.GH_RuntimeMessageLevel.Error, msg)

dt = "" if dt is None else dt
dtMin = "" if dtMin is None else dtMin
dtMax = "" if dtMax is None else dtMax
Jd = "" if Jd is None else Jd

checkData = True

if not numIncr:
    checkData = False
    msg = "Input parameter numIncr failed to collect data"
    ghenv.Component.AddRuntimeMessage(gh.Kernel.GH_RuntimeMessageLevel.Warning, msg)

if checkData:
    AnalysisSteps = alpaca.AnalysisSteps(numIncr, dt, dtMin, dtMax, Jd)
# ---------- end as ----------
as_2 = AnalysisSettingsAlpaca4d(AnalysisSteps=as)  # -> Settings
# ---------- as_2: Python ----------
"""
Create Analysis settings
-
    Args:
        Constraint: 'Plain', 'Transformation'. Default is 'Transformation'.
        Numberer: 'RCM', 'AMD', 'Plain'. Default is 'RCM'.
        System: 'BandGen', 'BandSPD', 'ProfileSPD', 'SuperLU', 'UmfPack', 'FullGeneral', 'SparseSYM'. Default is 'BandSPD'.
        Test: Feature not implemented. Please contact alpaca4d@gmail.com 
        Algorithm: 'Linear', 'Newton', 'NewtonLineSearch', 'ModifiedNewton', 'KrylovNewton', 'SecantNewton', 'BFGS', 'Broyden'. Default is 'Linear'.
        Integrator: Default is LoadControl.
        AnalysisType: 'Static', 'Transient'. Default is 'Static'.
        AnalyesSteps:
    Returns:
        Analysis:
"""

import sys
import os


import clr
import clrtype
import Rhino.Geometry as rg
import rhinoscriptsyntax as rs
import Grasshopper as gh
import copy
import ghpythonlib.treehelpers as th


ghenv.Component.Name = "Analysis settings (Alpaca4d)"
ghenv.Component.NickName = 'AS'
ghenv.Component.Message = "Analysis settings \n(Alpaca4d)"



from Alpaca4d import alpaca4d as alpaca

checkData = True


# default Value
Constraint = 'Transformation' if Constraint is None else Constraint
ConstraintList = ['Plain', 'Transformation']

for item in ConstraintList:
    if Constraint.lower() == item.lower():
        print(item)
        Constraint = item


# default Value
Numberer = 'RCM' if Numberer is None else Numberer
NumbererList = ['RCM', 'AMD', 'Plain', 'ParallelPlain', 'ParallelRCM']

for i,item in enumerate(NumbererList):
    if Numberer.lower() == item.lower():
        Numberer = item



# default Value
System = 'BandSPD' if System is None else System
SystemList = ['BandGen', 'BandSPD', 'ProfileSPD', 'SuperLU', 'UmfPack', 'FullGeneral', 'SparseSYM']

for i,item in enumerate(SystemList):
    if System.lower() == item.lower():
        System = item


# default Test
Test = 'NormDispIncr 1.0e-6 12 5' if Test is None else Test




# default Value
Algorithm = 'Linear' if Algorithm is None else Algorithm
AlgorithmList = ['Linear', 'Newton', 'NewtonLineSearch', 'ModifiedNewton', 'KrylovNewton', 'SecantNewton', 'BFGS', 'Broyden']

for i,item in enumerate(AlgorithmList):
    if Algorithm.lower() == item.lower():
        Algorithm = item


# default Value
AnalysisType = 'Static' if AnalysisType is None else AnalysisType
AnalysisTypeList = ['Static', 'Transient']

for item in AnalysisTypeList:
    if AnalysisType.lower() == item.lower():
        AnalysisType = item


## Define Integrator
if AnalysisType == "Static":
    Integrator = "LoadControl 1.0" if Integrator is None else Integrator
elif AnalysisType == "Transient":
    Integrator = "Newmark 0.5 0.25" if Integrator is None else Integrator



if not AnalysisSteps:
    checkData = False
    msg = "Input parameter AnalysisSteps failed to collect data"
    ghenv.Component.AddRuntimeMessage(gh.Kernel.GH_RuntimeMessageLevel.Warning, msg)


if checkData:
    Settings = alpaca.Analysis(Constraint, Numberer,System,Test,Algorithm,Integrator,AnalysisType, AnalysisSteps)
    print(Settings.write_tcl())
# ---------- end as_2 ----------
ra = RunAnalysisAlpaca4d(AlpacaModel=am.AlpacaModel, Settings=as_2)  # -> log, AlpacaSolvedModel
# ---------- ra: Python ----------
"""
Run an OpenSees Analysis
-
    Args:
        AlpacaModel:
        Settings:
    Returns:
        AlpacaSolvedModel:
"""



import Rhino.RhinoDoc
import Grasshopper as gh
import copy
import rhinoscriptsyntax as rs
import os
import time
import sys



ghenv.Component.Name = "Run Analysis (Alpaca4d)"
ghenv.Component.NickName = 'RA'
ghenv.Component.Message = "Run Analysis (Alpaca4d)"

ghcompfolder = gh.Folders.DefaultAssemblyFolder
if ghcompfolder not in sys.path:
    sys.path.append(ghcompfolder)

try:
    from Alpaca4d import alpaca4d as alpaca
except:
    msg = "Cannot import Alpaca4d. Is the Alpaca4d folder available in " + ghcompfolder + "?"
    ghenv.Component.AddRuntimeMessage(gh.Kernel.GH_RuntimeMessageLevel.Error, msg)


checkData = True



if not AlpacaModel:
    checkData = False
    msg = "Input parameter AlpacaModel failed to collect data"
    ghenv.Component.AddRuntimeMessage(gh.Kernel.GH_RuntimeMessageLevel.Warning, msg)


if not Settings:
    checkData = False
    msg = "Input parameter Settings failed to collect data"
    ghenv.Component.AddRuntimeMessage(gh.Kernel.GH_RuntimeMessageLevel.Warning, msg)


if checkData:
    FolderPath = rs.DocumentPath()
    os.chdir(FolderPath)
    
    outputFileName = 'openSeesModel'
    recorderFileName = 'recorder.mpco'
    
    for dirpath, dirnames, filenames in os.walk(FolderPath):
        for filename in filenames:
            if filename == outputFileName:
                file = os.path.join(dirpath,outputFileName)
                os.remove(file)
            elif filename == recorderFileName:
                file = os.path.join(dirpath,recorderFileName)
                os.remove(file)
    
    
    # create a copy
    
    AnalysisModel = copy.copy(AlpacaModel)
    AnalysisModel.py = list(AnalysisModel.py)
    
    # generate Recorder and assign name
    AnalysisModel.recorderName = "recorder" + ".mpco"
    
    AnalysisModel.py.append(alpaca.TCLRecorder.mpco(AnalysisModel.recorderName, True,True,True,True,False,False,True,True,True,True))
    
    
    AnalysisModel.analysis = Settings
    AnalysisModel.py.append(Settings.write_tcl())
    AnalysisModel.py.append("wipe")
    
    
    #textFile = AnalysisModel.py
    
    time_start = time.clock()
    
    AnalysisModel.writeFile(outputFileName)
    
    time_elapsed = (time.clock() - time_start)
    print("Writing Time {}".format(time_elapsed))
    
    
    
    time_start = time.clock()
    
    executable = os.path.join(ghcompfolder,'Alpaca4d\OpenSees-Solvers\opensees.bat')
    a, log = AnalysisModel.runOpensees(executable)
    
    
    time_elapsed = (time.clock() - time_start)
    print("Analyses Time {}".format(time_elapsed))
    
    AlpacaSolvedModel = copy.copy(AnalysisModel)
    AlpacaSolvedModel.isAnalysed = True
# ---------- end ra ----------
panel_2 = Panel(ra.log)
clr = ColorsAlpaca4d(gradIndex=Slider(11, range=0..12))  # -> reverse(colors); inputs gradIndex: Int32
#   port colors: A series of colors to be plugged into the "Ladybug_Legend Parameters" component.
# ---------- clr: Python ----------
"""
Preset of gradient colors perfect for Data Visualisation
    Inputs:
        gradIndex: An index refering to one of the following possible gradients:
            0 - Orignal Ladybug
            1 - Nuanced Ladybug
            2 - Multi-colored Ladybug
            3 - Ecotect
            4 - Thermal Comfort Percentage
            5 - Thermal Comfort Colors
            6 - Shade Benefit/Harm
            7 - Shade Harm
            8 - Shade Benefit
            9 - CFD Colors 1
            10 - Radiation Benefit
            11 - Gsa10 Colour
            12 - Gsa9 Colour
    Returns:
        customColors: A series of colors.
"""

ghenv.Component.Name = "Colors (Alpaca4d)"
ghenv.Component.NickName = 'CLR'
ghenv.Component.Message = 'Colors (Alpaca4d)'

import scriptcontext as sc
import Grasshopper.Kernel as gh
import System

gradientLibrary = {
        0: [System.Drawing.Color.FromArgb(75, 107, 169), System.Drawing.Color.FromArgb(115, 147, 202), System.Drawing.Color.FromArgb(170, 200, 247), System.Drawing.Color.FromArgb(193, 213, 208), System.Drawing.Color.FromArgb(245, 239, 103), System.Drawing.Color.FromArgb(252, 230, 74), System.Drawing.Color.FromArgb(239, 156, 21), System.Drawing.Color.FromArgb(234, 123, 0), System.Drawing.Color.FromArgb(234, 74, 0), System.Drawing.Color.FromArgb(234, 38, 0)],
        1: [System.Drawing.Color.FromArgb(49,54,149), System.Drawing.Color.FromArgb(69,117,180), System.Drawing.Color.FromArgb(116,173,209), System.Drawing.Color.FromArgb(171,217,233), System.Drawing.Color.FromArgb(224,243,248), System.Drawing.Color.FromArgb(255,255,191), System.Drawing.Color.FromArgb(254,224,144), System.Drawing.Color.FromArgb(253,174,97), System.Drawing.Color.FromArgb(244,109,67), System.Drawing.Color.FromArgb(215,48,39), System.Drawing.Color.FromArgb(165,0,38)],
        2: [System.Drawing.Color.FromArgb(4,25,145), System.Drawing.Color.FromArgb(7,48,224), System.Drawing.Color.FromArgb(7,88,255), System.Drawing.Color.FromArgb(1,232,255), System.Drawing.Color.FromArgb(97,246,156), System.Drawing.Color.FromArgb(166,249,86), System.Drawing.Color.FromArgb(254,244,1), System.Drawing.Color.FromArgb(255,121,0), System.Drawing.Color.FromArgb(239,39,0), System.Drawing.Color.FromArgb(138,17,0)],
        3: [System.Drawing.Color.FromArgb(0,0,255), System.Drawing.Color.FromArgb(53,0,202), System.Drawing.Color.FromArgb(107,0,148), System.Drawing.Color.FromArgb(160,0,95), System.Drawing.Color.FromArgb(214,0,41), System.Drawing.Color.FromArgb(255,12,0), System.Drawing.Color.FromArgb(255,66,0), System.Drawing.Color.FromArgb(255,119,0), System.Drawing.Color.FromArgb(255,173,0), System.Drawing.Color.FromArgb(255,226,0), System.Drawing.Color.FromArgb(255,255,0)],
        4: [System.Drawing.Color.FromArgb(0,0,0), System.Drawing.Color.FromArgb(110,0,153), System.Drawing.Color.FromArgb(255,0,0), System.Drawing.Color.FromArgb(255,255,102), System.Drawing.Color.FromArgb(255,255,255)],
        5: [System.Drawing.Color.FromArgb(0,136,255), System.Drawing.Color.FromArgb(200,225,255), System.Drawing.Color.FromArgb(255,255,255), System.Drawing.Color.FromArgb(255,230,230), System.Drawing.Color.FromArgb(255,0,0)],
        6: [System.Drawing.Color.FromArgb(5,48,97), System.Drawing.Color.FromArgb(33,102,172), System.Drawing.Color.FromArgb(67,147,195), System.Drawing.Color.FromArgb(146,197,222), System.Drawing.Color.FromArgb(209,229,240), System.Drawing.Color.FromArgb(255,255,255), System.Drawing.Color.FromArgb(253,219,199), System.Drawing.Color.FromArgb(244,165,130), System.Drawing.Color.FromArgb(214,96,77), System.Drawing.Color.FromArgb(178,24,43), System.Drawing.Color.FromArgb(103,0,31)],
        7: [System.Drawing.Color.FromArgb(255,255,255), System.Drawing.Color.FromArgb(253,219,199), System.Drawing.Color.FromArgb(244,165,130), System.Drawing.Color.FromArgb(214,96,77), System.Drawing.Color.FromArgb(178,24,43), System.Drawing.Color.FromArgb(103,0,31)],
        8: [System.Drawing.Color.FromArgb(255,255,255), System.Drawing.Color.FromArgb(209,229,240), System.Drawing.Color.FromArgb(146,197,222), System.Drawing.Color.FromArgb(67,147,195), System.Drawing.Color.FromArgb(33,102,172), System.Drawing.Color.FromArgb(5,48,97)],
        9: [System.Drawing.Color.FromArgb(0,16,120), System.Drawing.Color.FromArgb(38,70,160), System.Drawing.Color.FromArgb(5,180,222), System.Drawing.Color.FromArgb(16,180,109), System.Drawing.Color.FromArgb(59,183,35), System.Drawing.Color.FromArgb(143,209,19), System.Drawing.Color.FromArgb(228,215,29), System.Drawing.Color.FromArgb(246,147,17), System.Drawing.Color.FromArgb(243,74,0), System.Drawing.Color.FromArgb(255,0,0)],
        10: [System.Drawing.Color.FromArgb(0,191,48), System.Drawing.Color.FromArgb(255,238,184), System.Drawing.Color.FromArgb(255,0,0)],
        11: [System.Drawing.Color.FromArgb(204,0,71), System.Drawing.Color.FromArgb(255,182,71), System.Drawing.Color.FromArgb(206,255,115), System.Drawing.Color.FromArgb(26,180, 214),System.Drawing.Color.FromArgb(0,0,207)],
        12: [System.Drawing.Color.FromArgb(255, 51, 51), System.Drawing.Color.FromArgb(255, 170, 51), System.Drawing.Color.FromArgb(255, 255, 51), System.Drawing.Color.FromArgb(170, 255, 125), System.Drawing.Color.FromArgb(51, 255, 231), System.Drawing.Color.FromArgb(51, 170, 255), System.Drawing.Color.FromArgb(51,51, 255)]}
colors = gradientLibrary[gradIndex]
# ---------- end clr ----------
panel_3 = Panel("3")
rf = ReactionForcesAlpaca4d(AlpacaModel=ra.AlpacaSolvedModel)  # -> out, SupportPosition, ReactionForce, ReactionMoment; inputs History: Boolean, step: Int32
# ---------- rf: Python ----------
"""
Read Reaction Forces
    Args:
        AlpacaModel:
        History:
        step:
    Returns:
        SupportPosition:
        ReactionForce:
        ReactionMoment:
        ReactionForce_History:
        ReactionMoment_History:
"""

ghenv.Component.Name = "Reaction Forces (Alpaca4d)"
ghenv.Component.NickName = 'RF'
ghenv.Component.Message = 'Reactions (Alpaca4d)'


import sys
import os
import System
from System.Drawing import Color


import clr
import clrtype
import Rhino.Geometry as rg
import rhinoscriptsyntax as rs
import Grasshopper as gh
import copy
import ghpythonlib.treehelpers as th



## add alpaca install directory to system path

ghcompfolder = gh.Folders.DefaultAssemblyFolder
if ghcompfolder not in sys.path:
    sys.path.append(ghcompfolder)

try:
    from Alpaca4d import alpaca4d as alpaca
except:
    msg = "Cannot import Alpaca4d. Is the Alpaca4d folder available in " + ghcompfolder + "?"
    ghenv.Component.AddRuntimeMessage(gh.Kernel.GH_RuntimeMessageLevel.Error, msg)



FolderPath = rs.DocumentPath()
os.chdir(FolderPath)

my_module_name = "Alpaca_StepReader" # replace this with something unique that doesn't collide with a real module!
my_module = sys.modules.setdefault(my_module_name, type(sys)(my_module_name))

hdfFilePath = os.path.join(ghcompfolder, "Alpaca4d\HDF5CSharp.dll")
clr.AddReferenceToFileAndPath(hdfFilePath)


from HDF5CSharp import Hdf5

try:
    Steps = my_module.Steps
except AttributeError:
    type_2d = type(System.Array.CreateInstance(float, 1, 1))

    class Steps(object):
        __metaclass__ = clrtype.ClrClass
        _clrfields = {"STEP_{}".format(i): type_2d for i in range(1000)} # it will work for model with less than 1000 steps

    my_module.Steps = Steps



checkData = True

if not AlpacaModel:
    checkData = False
    msg = "Input parameter AlpacaModel failed to collect data"
    ghenv.Component.AddRuntimeMessage(gh.Kernel.GH_RuntimeMessageLevel.Warning, msg)



History = False if History is None else History


if checkData:
    step = (int(AlpacaModel.analysis.AnalysisSteps.numIncr) - 1) if step is None else step
    supportTagLocation = [item.nodeTag - 1 for item in AlpacaModel.supports] #
    
    if not History:
    
        try:
            fileId = Hdf5.OpenFile(AlpacaModel.recorderName, True)
            
            
            reactionForceResult = Hdf5.ReadObject[Steps](fileId, "/MODEL_STAGE[1]/RESULTS/ON_NODES/REACTION_FORCE/DATA")
            ReactionForce = []
            for i in supportTagLocation:
                x = getattr(reactionForceResult, 'STEP_{}'.format(step))[i,0]
                y = getattr(reactionForceResult, 'STEP_{}'.format(step))[i,1]
                z = getattr(reactionForceResult, 'STEP_{}'.format(step))[i,2]
                ReactionForce.append(rg.Vector3d(x,y,z))
            
            
            ReactionMomentResult = Hdf5.ReadObject[Steps](fileId, "/MODEL_STAGE[1]/RESULTS/ON_NODES/REACTION_MOMENT/DATA")
            ReactionMoment = []
            for i in supportTagLocation:
                x = getattr(ReactionMomentResult, 'STEP_{}'.format(step))[i,0]
                y = getattr(ReactionMomentResult, 'STEP_{}'.format(step))[i,1]
                z = getattr(ReactionMomentResult, 'STEP_{}'.format(step))[i,2]
                ReactionMoment.append(rg.Vector3d(x,y,z))
                
            Hdf5.CloseFile(fileId)
            
        except:
            if fileId >0:
                Hdf5.CloseFile(fileId)
                print("I have closed the file")
    
    
    if History:
        try:
            fileId = Hdf5.OpenFile(AlpacaModel.recorderName, True)
        
            maxNumberStep = int(AlpacaModel.analysis.AnalysisSteps.numIncr)
            
            reactionForceResult = Hdf5.ReadObject[Steps](fileId, "/MODEL_STAGE[1]/RESULTS/ON_NODES/REACTION_FORCE/DATA")
            ReactionForce = []
            for i in supportTagLocation:
                reactionForceTemp = []
                for n_step in range(maxNumberStep):
                    x = getattr(reactionForceResult, 'STEP_{}'.format(n_step))[i,0]
                    y = getattr(reactionForceResult, 'STEP_{}'.format(n_step))[i,1]
                    z = getattr(reactionForceResult, 'STEP_{}'.format(n_step))[i,2]
                    reactionForceTemp.append(rg.Vector3d(x,y,z))
            
                ReactionForce.append(reactionForceTemp)
    
    
            reactionMomentResult = Hdf5.ReadObject[Steps](fileId, "/MODEL_STAGE[1]/RESULTS/ON_NODES/REACTION_MOMENT/DATA")
            ReactionMoment = []
            for i in supportTagLocation:
                reactionMomentTemp = []
                for n_step in range(maxNumberStep):
                    x = getattr(reactionMomentResult, 'STEP_{}'.format(n_step))[i,0]
                    y = getattr(reactionMomentResult, 'STEP_{}'.format(n_step))[i,1]
                    z = getattr(reactionMomentResult, 'STEP_{}'.format(n_step))[i,2]
                    reactionMomentTemp.append(rg.Vector3d(x,y,z))
            
                ReactionMoment.append(reactionMomentTemp)
            Hdf5.CloseFile(fileId)
            
        except:
            Hdf5.CloseFile(fileId)
    
    
    
    
    SupportPosition = [item.Pos for item in AlpacaModel.supports]
    ReactionForce = th.list_to_tree(ReactionForce)
    ReactionMoment = th.list_to_tree(ReactionMoment)
# ---------- end rf ----------
dm = DeformedModelAlpaca4d(AlpacaSolvedModel=ra.AlpacaSolvedModel, extrudeModel=Toggle(True), listColor=clr)  # -> DefModel, bounds; inputs step: Int32, extrudeModel: Boolean, typeColor: Int32, listColor: list of Color
# ---------- dm: Python ----------
"""View Deformed model
    Args:
        AlpacaSolvedModel: Output of Analyses solver
        step:
        scale: Multiplication factor for displacement
        extrudeModel:  
True : view extruded model
else : view stick model
        typeColor:  View relative color of the traslation
<=0 : view traslation X 
1 : view traslation Y
2 : view traslation Z
>= 3 : view resulting displacement.
        listColor : one list of color 

    Output:
       DefModel: view deformed model
       bounds: max end min of displacement of the structure 
"""

ghenv.Component.Name = "Deformed Model (Alpaca4d)"
ghenv.Component.NickName = 'DM'
ghenv.Component.Message = "Deformed Model (Alpaca4d)"

from ghpythonlib.componentbase import executingcomponent as component
import System
import rhinoscriptsyntax as rs

import sys
import os
import clr
import clrtype
import Rhino.Geometry as rg
import Rhino as rc
import math as mt
import Grasshopper as gh
import ghpythonlib.treehelpers as th
from ghpythonlib.components import ConstructDomain

ghcompfolder = gh.Folders.DefaultAssemblyFolder
if ghcompfolder not in sys.path:
    sys.path.append(ghcompfolder)
try:
    from Alpaca4d import alpaca4dView as alpacaView
except:
    msg = "Cannot import Alpaca4d. Is the Alpaca4d folder available in " + ghcompfolder + "?"
    ghenv.Component.AddRuntimeMessage(gh.Kernel.GH_RuntimeMessageLevel.Error, msg)
    
FolderPath = rs.DocumentPath()
os.chdir(FolderPath)

ghcompfolder = gh.Folders.DefaultAssemblyFolder
my_module_name = "Alpaca_StepReader"
my_module = sys.modules.setdefault(my_module_name, type(sys)(my_module_name))


try:
    Steps_dm = my_module.Steps_dm
    Modes = my_module.Modes
except AttributeError:
    type_2d = type(System.Array.CreateInstance(float, 1, 1))

    class Steps_dm(object):
        __metaclass__ = clrtype.ClrClass
        _clrfields = {"STEP_{}".format(i): type_2d for i in range(1000)} # it will work for model with less than 1000 steps

    class Modes(object):
        __metaclass__ = clrtype.ClrClass
        _clrfields = {"MODE_{}".format(i): type_2d for i in range(1000)} # it will work for model with less than 1000 steps

    my_module.Steps_dm = Steps_dm
    my_module.Modes = Modes


hdfFilePath = os.path.join(ghcompfolder, "Alpaca4d\HDF5CSharp.dll")
clr.AddReferenceToFileAndPath(hdfFilePath)

from HDF5CSharp import Hdf5

class MyComponent(component):
    
    def RunScript(self, AlpacaSolvedModel, step = None, scale = None , extrudeModel = None, typeColor = None, listColor = [] ):
        import sys
        
        self.extrudeModel = extrudeModel
        
        self.defModel1 = []
        self.defModel2 = []
        self.defModel3 = []
        
        self.beamColor = []
        

        if step == None:
            step = 0
        if extrudeModel == None:
            extrudeModel = False
        if typeColor == None:
            typeColor = 3
        
        if not listColor: listColor = [ System.Drawing.Color.DarkViolet, 
                                        System.Drawing.Color.BlueViolet, 
                                        System.Drawing.Color.RoyalBlue, 
                                        System.Drawing.Color.CornflowerBlue,
                                        System.Drawing.Color.LightSkyBlue, 
                                        System.Drawing.Color.LightBlue,
                                        System.Drawing.Color.CadetBlue,
                                        System.Drawing.Color.LightGreen,
                                        System.Drawing.Color.GreenYellow,
                                        System.Drawing.Color.Yellow,
                                        System.Drawing.Color.Orange,
                                        System.Drawing.Color.Red,
                                        System.Drawing.Color.DarkRed]
            
        checkData = True
        
        if not AlpacaSolvedModel:
            checkData = False
            msg = "Input parameter AlpacaSolvedModel failed to collect data"
            ghenv.Component.AddRuntimeMessage(gh.Kernel.GH_RuntimeMessageLevel.Warning, msg)
        else:
            try:
                fileId = Hdf5.OpenFile(AlpacaSolvedModel.recorderName, True)
                print( AlpacaSolvedModel.recorderName)
                numberOfPoints = len(AlpacaSolvedModel.uniquePoints) #
                
                displacement = []
                rotation = []
                dispNodeList = []
                
                if AlpacaSolvedModel.isModal == True:
                    print( AlpacaSolvedModel.isModal == True )
                    outputData = "MODEL_STAGE[1]/RESULTS/ON_NODES/MODES_OF_VIBRATION(U)/DATA/STEP_0"
                    print( outputData )
                    displacementResult = Hdf5.ReadObject[Modes](fileId, outputData)
                    for i in range(numberOfPoints):
                        tag = i + 1
                        vx = getattr(displacementResult, 'MODE_{}'.format(step))[i,0]
                        vy = getattr(displacementResult, 'MODE_{}'.format(step))[i,1]
                        vz = getattr(displacementResult, 'MODE_{}'.format(step))[i,2]
                        trasl = rg.Vector3d(vx,vy,vz)
                        displacement.append(trasl)
                        dispNodeList.append( [tag, trasl] )
                        
                    Hdf5.CloseFile(fileId)
                    print("I have closed the file")
                else: 
                    outputData = "/MODEL_STAGE[1]/RESULTS/ON_NODES/DISPLACEMENT/DATA"
                    print( outputData )
                    displacementResult = Hdf5.ReadObject[Steps_dm](fileId, outputData)
                    for i in range(numberOfPoints):
                        tag = i + 1
                        vx = getattr(displacementResult, 'STEP_{}'.format(step))[i,0]
                        vy = getattr(displacementResult, 'STEP_{}'.format(step))[i,1]
                        vz = getattr(displacementResult, 'STEP_{}'.format(step))[i,2]
                        trasl = rg.Vector3d(vx,vy,vz)
                        displacement.append(trasl)
                        dispNodeList.append( [tag, trasl] )
                        
                    Hdf5.CloseFile(fileId)
                    print("I have closed the file")
            
                dispNodeDict = dict( dispNodeList )
                #---------------------------------------------------#
                defEleVector1 = alpacaView.BeamVectorDef(AlpacaSolvedModel,dispNodeDict) #beam
                defEleVector2 = alpacaView.ShellVectorDef(AlpacaSolvedModel,dispNodeDict) #shell
                defEleVector3 = alpacaView.BrickVectorDef(AlpacaSolvedModel,dispNodeDict) #shell
                bound = alpacaView.boundsDef(displacement, typeColor)
                if scale == None: scale = 1/bound[1]
                if self.extrudeModel == None or self.extrudeModel == False:
                    #BEAM
                    defModel1 = alpacaView.BeamDef(AlpacaSolvedModel, dispNodeDict,scale)
                    self.defModel1, self.beamColor = alpacaView.ColorBeamDef( defModel1, defEleVector1, bound, listColor, typeColor)
                    #SHELL
                    defModel2 = alpacaView.ShellDef(AlpacaSolvedModel,dispNodeDict,scale)
                    #BRICK
                    defModel3 = alpacaView.BrickDef(AlpacaSolvedModel,dispNodeDict,scale)
                else:
                    #BEAM
                    defModel1 = alpacaView.BeamDefExtrude(AlpacaSolvedModel, dispNodeDict,scale)
                    self.defModel1 = alpacaView.ColorBeamDefExtrude( defModel1, defEleVector1, bound, listColor, typeColor)
                    #SHELL
                    defModel2 = alpacaView.ShellDefExtrude(AlpacaSolvedModel,dispNodeDict,scale)
                    #BRICK
                    defModel3 = alpacaView.BrickDef(AlpacaSolvedModel,dispNodeDict,scale)
                    
                #SHELL COLOR
                self.defModel2 = alpacaView.ColorShellDef( defModel2, defEleVector2 , bound, listColor, typeColor, extrudeModel )
                #BRICK COLOR
                self.defModel3 = alpacaView.ColorBrickDef( defModel3, defEleVector3 , bound, listColor, typeColor)
                DefModel = th.list_to_tree(self.defModel1 + defModel2 + defModel3)
                bounds = ConstructDomain(bound[0], bound[1])
                return (DefModel, bounds)
            except:
                Hdf5.CloseFile(fileId)
                print("I have closed the file due to exception")
            # return outputs if you have them; here I try it for you:
        
        
    def DrawViewportWires(self,arg):
        for iMesh in self.defModel2 :
            colorWirframe = System.Drawing.Color.Black
            arg.Display.DrawMeshWires(iMesh, colorWirframe)
            
        for iMesh in self.defModel3 :
            colorWirframe = System.Drawing.Color.Black
            arg.Display.DrawMeshWires(iMesh, colorWirframe)
        if self.extrudeModel is None or self.extrudeModel is False:
            thickness =2
            for iBeam, iColor in zip(self.defModel1, self.beamColor) :
                for jBeam, jColor in zip(iBeam, iColor):
                    arg.Display.DrawCurve(jBeam, jColor, thickness)
        else:
            for iBeam in self.defModel1 :
                colorWirframe = System.Drawing.Color.Black
                arg.Display.DrawMeshWires(iBeam, colorWirframe)
# ---------- end dm ----------
bfd = BeamForcesDiagramAlpaca4d(AlpacaSolvedModel=ra.AlpacaSolvedModel, step="0", cdsType=Slider(1, range=0..5), scale="0.1", viewValue=Toggle(False))  # -> ForcesDiagram; inputs step: Int32, cdsType: Int32
# ---------- bfd: Python ----------
"""
View Diagram of internal beam forces

    Args:
        AlpacaModel:
        cdsType: 
    0: to view N (forces in direction 3)
    1: to view M2 (Moments around axis 2)
    2: to view T1 (forces in direction 1)
    3: to view M1 (Moments around axis 1)
    4: to view T2 (forces in direction 2)
    5: to view Mt (Moments around axis 3)
        step:
        scale: scale factor
        viewValue: to view the force value
    Returns:
        ForcesDiagram: Diagram of internal beam forces
"""


ghenv.Component.Name = "BeamForcesDiagram (Alpaca4d)"
ghenv.Component.NickName = 'BFD'
ghenv.Component.Message = "Beam Forces Diagram (Alpaca4d)"

from ghpythonlib.componentbase import executingcomponent as component
import Grasshopper, GhPython
import rhinoscriptsyntax as rs
import sys
import os
import System
import clr
import Rhino.Geometry as rg
import Grasshopper as gh
import copy
import Rhino


from Alpaca4d import alpaca4d as alpaca
from Alpaca4d import alpaca4dView as alpacaView
FolderPath = rs.DocumentPath()
os.chdir(FolderPath)

ghcompfolder = gh.Folders.DefaultAssemblyFolder
if ghcompfolder not in sys.path:
    sys.path.append(ghcompfolder)

# import costum modules to read the hdf5 file
my_module_name = "Alpaca_StepReader"
my_module = sys.modules.setdefault(my_module_name, type(sys)(my_module_name))

hdfFilePath = os.path.join(ghcompfolder, "Alpaca4d\HDF5CSharp.dll")
clr.AddReferenceToFileAndPath(hdfFilePath)

from HDF5CSharp import Hdf5

try:
    Steps = my_module.Steps
except AttributeError:
    type_2d = type(System.Array.CreateInstance(float, 1, 1))

    class Steps(object):
        __metaclass__ = clrtype.ClrClass
        _clrfields = {"STEP_{}".format(i): type_2d for i in range(1000)} # it will work for model with less than 1000 steps
    
    my_module.Steps = Steps

checkData = True

class MyComponent(component):
    
    def RunScript(self, AlpacaSolvedModel, step, cdsType, scale, viewValue):
        
        self.viewValue = viewValue
        
        
        self.Pos = []
        self.Valor = []
        self.ForcesDiagram = []
        
        
        if not AlpacaSolvedModel:
            checkData = False
            msg = "Input parameter AlpacaSolvedModel failed to collect data"
            ghenv.Component.AddRuntimeMessage(gh.Kernel.GH_RuntimeMessageLevel.Warning, msg)
        else:
            try:
                fileId = Hdf5.OpenFile(AlpacaSolvedModel.recorderName, True)
                
                stressResult = Hdf5.ReadObject[Steps](fileId, "/MODEL_STAGE[1]/RESULTS/ON_ELEMENTS/section.force/74-ForceBeamColumn3d[1000:1:0]/DATA")
                #stressResult = Hdf5.ReadObject[Steps](fileId, "/MODEL_STAGE[1]/RESULTS/ON_ELEMENTS/stresses/167-UnknownMovableObject[103:0:0]/DATA")
                if cdsType <= 0:
                    versorType, startRange, colorPos, colorNeg = 1, 0, System.Drawing.Color.SteelBlue, System.Drawing.Color.LightSalmon
                elif cdsType == 1:
                    versorType, startRange, colorPos, colorNeg = 1, 1, System.Drawing.Color.Aqua, System.Drawing.Color.IndianRed
                elif cdsType== 2:
                    versorType, startRange, colorPos, colorNeg = 1, 2, System.Drawing.Color.LightSalmon, System.Drawing.Color.LightSalmon
                elif cdsType == 3:
                    versorType, startRange, colorPos, colorNeg = 2, 3, System.Drawing.Color.SteelBlue, System.Drawing.Color.Yellow
                elif cdsType == 4:
                    versorType, startRange, colorPos, colorNeg = 2, 4, System.Drawing.Color.LawnGreen, System.Drawing.Color.LawnGreen
                else:
                    versorType, startRange, colorPos, colorNeg = 2, 5, System.Drawing.Color.BlueViolet, System.Drawing.Color.BlueViolet
                
                if scale is None : scale = 0.0025
                if step is None :  step = (int(AlpacaSolvedModel.analysis.NumberOfSteps) - 1) if step is None else step
                
                CDSView = []
                CDSPoint = []
                CDSValor = []
            
                for i,item in enumerate(AlpacaSolvedModel.beams):
                    ni = 5 # potrebbe cambiare per ogni trave
                    #Versore
                    e = item.getPerpFrame()[versorType]*-1
                    print(e)
                    valor = [ getattr(stressResult, 'STEP_{}'.format(step))[i,j] for j in range(startRange,ni*6, 6)]
                    print(valor)
                    cdsVector = [ rg.Vector3d.Multiply(e, ivalor*scale) for ivalor in valor ]
                    #----------------------------------------------------------------#
                    cdsView, cdsPoint = alpacaView.cdsMesh( item, cdsVector, colorPos, colorNeg)
                    CDSView.append(cdsView)
                    CDSPoint.append(cdsPoint)
                    CDSValor.append(valor)
                    
                Hdf5.CloseFile(fileId)
                
                self.Pos = CDSPoint
                self.Valor = CDSValor
                self.ForcesDiagram = CDSView
                return self.ForcesDiagram
            except:
                Hdf5.CloseFile(fileId)
    
        
    def DrawViewportWires(self,arg):
        # node Tag view
        for iPos, ivalor, iMesh in zip(self.Pos, self.Valor, self.ForcesDiagram) :
            colorWirframe = System.Drawing.Color.Black
            arg.Display.DrawMeshWires(iMesh, colorWirframe)
            if self.viewValue is True:
                for jpos, jvalor in zip(iPos, ivalor):
                    t = 25
                    txt = str( round( jvalor, 2))
                    arg.Display.Draw2dText( txt, System.Drawing.Color.Black, jpos, True, t)
# ---------- end bfd ----------
nd = NodalDisplacementsAlpaca4d(AlpacaModel=ra.AlpacaSolvedModel, History=Toggle(False))  # -> out, displacement, rotation; inputs History: Boolean, step: Int32
# ---------- nd: Python ----------
"""
Read displacement results
-
    Args:
        AlpacaModel:
        History: True to visualise the displacement and rotation history of the points
        step:
    Returns:
        displacement:
        rotation:
        displacement_History:
        rotation_History:
"""

ghenv.Component.Name = "Nodal Displacements (Alpaca4d)"
ghenv.Component.NickName = 'ND'
ghenv.Component.Message = "Displacements (Alpaca4d)"

import sys
import os
import System
from System.Drawing import Color


import clr
import clrtype
import Rhino.Geometry as rg
import rhinoscriptsyntax as rs
import Grasshopper as gh
import copy
import ghpythonlib.treehelpers as th



## add alpaca install directory to system path

ghcompfolder = gh.Folders.DefaultAssemblyFolder
if ghcompfolder not in sys.path:
    sys.path.append(ghcompfolder)

try:
    from Alpaca4d import alpaca4d as alpaca
except:
    msg = "Cannot import Alpaca4d. Is the Alpaca4d folder available in " + ghcompfolder + "?"
    ghenv.Component.AddRuntimeMessage(gh.Kernel.GH_RuntimeMessageLevel.Error, msg)



FolderPath = rs.DocumentPath()
os.chdir(FolderPath)

my_module_name = "Alpaca_StepReader" # replace this with something unique that doesn't collide with a real module!
my_module = sys.modules.setdefault(my_module_name, type(sys)(my_module_name))

hdfFilePath = os.path.join(ghcompfolder, "Alpaca4d\HDF5CSharp.dll")
clr.AddReferenceToFileAndPath(hdfFilePath)


from HDF5CSharp import Hdf5

try:
    Steps = my_module.Steps
except AttributeError:
    type_2d = type(System.Array.CreateInstance(float, 1, 1))

    class Steps(object):
        __metaclass__ = clrtype.ClrClass
        _clrfields = {"STEP_{}".format(i): type_2d for i in range(10000)} # it will work for model with less than 1000 steps

    my_module.Steps = Steps



checkData = True

if not AlpacaModel:
    checkData = False
    msg = "Input parameter AlpacaModel failed to collect data"
    ghenv.Component.AddRuntimeMessage(gh.Kernel.GH_RuntimeMessageLevel.Warning, msg)



History = False if History is None else History


if checkData:
    step = (int(AlpacaModel.analysis.AnalysisSteps.numIncr) - 1) if step is None else step
    numberOfPoints = len(AlpacaModel.uniquePoints) #
    
    if not History:
        try:
            fileId = Hdf5.OpenFile(AlpacaModel.recorderName, True)
            
            
            displacementResult = Hdf5.ReadObject[Steps](fileId, "/MODEL_STAGE[1]/RESULTS/ON_NODES/DISPLACEMENT/DATA")
            displacement = []
            for i in range(numberOfPoints):
                x = getattr(displacementResult, 'STEP_{}'.format(step))[i,0]
                y = getattr(displacementResult, 'STEP_{}'.format(step))[i,1]
                z = getattr(displacementResult, 'STEP_{}'.format(step))[i,2]
                displacement.append(rg.Vector3d(x,y,z))
            
            
            rotationResult = Hdf5.ReadObject[Steps](fileId, "/MODEL_STAGE[1]/RESULTS/ON_NODES/ROTATION/DATA")
            rotation = []
            for i in range(numberOfPoints):
                x = getattr(rotationResult, 'STEP_{}'.format(step))[i,0]
                y = getattr(rotationResult, 'STEP_{}'.format(step))[i,1]
                z = getattr(rotationResult, 'STEP_{}'.format(step))[i,2]
                rotation.append(rg.Vector3d(x,y,z))
                
                
            Hdf5.CloseFile(fileId)
            print("I have closed the file")
        except:
            if fileId >0:
                Hdf5.CloseFile(fileId)
                print("I have closed the file because of exception")
    
    
    
    if History:
        try:
            fileId = Hdf5.OpenFile(AlpacaModel.recorderName, True)
            
            displacementResult = Hdf5.ReadObject[Steps](fileId, "/MODEL_STAGE[1]/RESULTS/ON_NODES/DISPLACEMENT/DATA")
            displacement = []
            
            for i in range(numberOfPoints):
                dispTemp = []
                maxNumberStep = int(AlpacaModel.analysis.AnalysisSteps.numIncr)
                for n_step in range(maxNumberStep):
                    x = getattr(displacementResult, 'STEP_{}'.format(n_step))[i,0]
                    y = getattr(displacementResult, 'STEP_{}'.format(n_step))[i,1]
                    z = getattr(displacementResult, 'STEP_{}'.format(n_step))[i,2]
                    dispTemp.append(rg.Vector3d(x,y,z))
                    
                
                displacement.append(dispTemp)
    
    
    
    
            rotationResult = Hdf5.ReadObject[Steps](fileId, "/MODEL_STAGE[1]/RESULTS/ON_NODES/ROTATION/DATA")
            
            rotation = []
            
            for i in range(numberOfPoints):
                rotationTemp = []
                for n_step in range(maxNumberStep):
                    x = getattr(rotationResult, 'STEP_{}'.format(n_step))[i,0]
                    y = getattr(rotationResult, 'STEP_{}'.format(n_step))[i,1]
                    z = getattr(rotationResult, 'STEP_{}'.format(n_step))[i,2]
                    rotationTemp.append(rg.Vector3d(x,y,z))
                
                rotation.append(rotationTemp)
                
            Hdf5.CloseFile(fileId)
        except:
            Hdf5.CloseFile(fileId)
    
    
    displacement = th.list_to_tree(displacement)
    rotation = th.list_to_tree(rotation)
# ---------- end nd ----------
mesh = Mesh(bfd)
mesh_2 = Mesh(dm.DefModel)
panel_4 = Panel(nd.displacement)
