# Grasshopper definition Palazzina.gh (Grasshopper 1.0.7)
# plug-ins: Kangaroo2 Components

dim_x = Slider(30, range=0..100)
dim_y = Slider(30, range=0..100)
int_y = Slider(5, range=0..100)
int_x = Slider(5, range=0..100)
n_piani = Slider(20, range=0..100)
angolo_max = Slider(0, range=0..360)

# ---- group: int Z
panel = Panel("4")

# ----
rectangle = Rectangle(Plane=PlaneXY(0, 0, 0), XSize=dim_x, YSize=dim_y, Radius=0)  # -> Rectangle, Length
series = Series(Start=0, Step=panel, Count=n_piani)
mesh_uv = MeshSurface(Surface=rectangle.Rectangle, UCount=int_y, VCount=int_x, Overhang=True, Equalize=False)
Z = UnitZ(Factor=series)
demesh = DeconstructMesh(Mesh=mesh_uv)  # -> Vertices, Faces, Colours, Normals
move = Move(Geometry=mesh_uv, Motion=Z)  # -> Geometry, Transform
galapagos = Galapagos(fitness=data_8, gene=angolo_max)
dom = ConstructDomain(DomainStart=0, DomainEnd=angolo_max)
lng = ListLength(List=move.Geometry)
area = Area(Geometry=move.Geometry)  # -> Area, Centroid
range = Range(Domain=dom, Steps=expr("x-1", lng))
xy = XYPlane(Origin=area.Centroid)
rad = Radians(Degrees=range)
rotate = Rotate(Geometry=move.Geometry, Angle=rad, Plane=xy)  # -> Geometry, Transform
demesh_2 = DeconstructMesh(Mesh=rotate.Geometry)  # -> Vertices, Faces, Colours, Normals

graft = GraftTree(Tree=rotate.Geometry, IncludeEmptyLists=True, IncludeNullItems=True)
nv = NakedVertices(Mesh=graft)  # -> ClothedIndex, NakedIndex, ClothedPts, NakedPts
data = Data(nv.NakedPts)
fcircle = CircleFit(Points=data)  # -> Circle, Radius, Deviation
alongcrv = SortAlongCurve(Points=data, Curve=fcircle.Circle)  # -> Points, Indices
pline = PolyLine(Vertices=alongcrv.Points, Closed=False)
explode = Explode(Curve=pline, Recursive=True)  # -> Segments, Vertices
item = ListItem(List=explode.Vertices, Index=Slider(57, range=0..100), Wrap=True)  # -> flatten(Item), flatten(Item1)
cull_i = CullIndex(List=item.Item, Indices="-1", Wrap=True)
cull_i_2 = CullIndex(List=item.Item1, Indices="-1", Wrap=True)
cull_i_3 = CullIndex(List=item.Item1, Indices="0", Wrap=True)
cull_i_4 = CullIndex(List=item.Item, Indices="0", Wrap=True)
ln = Line(StartPoint=cull_i, EndPoint=cull_i_3)
ln_2 = Line(StartPoint=cull_i_2, EndPoint=cull_i_4)

cull_i_5 = CullIndex(List=rotate.Geometry, Indices="0", Wrap=True)
item_2 = ListItem(List=rotate.Geometry, Index="0", Wrap=True)
flip = FlipMatrix(Data=demesh_2.Vertices)
faceb = FaceBoundaries(Mesh=cull_i_5)
pline_2 = PolyLine(Vertices=flip, Closed=False)
explode_2 = Explode(Curve=faceb, Recursive=True)  # -> Segments, Vertices
explode_3 = Explode(Curve=pline_2, Recursive=True)  # -> Segments, Vertices
dupln = RemoveDuplicateLines(Lines=flatten(explode_2.Segments), Tolerance=0.01)
cluster = Cluster_2(T=rotate.Geometry, i=Slider(19, range=17..21))  # disabled
cluster_2 = Cluster_2(T=rotate.Geometry, i=Slider(9, range=7..11))  # disabled
cluster_3 = Cluster_2(T=rotate.Geometry, i=Slider(6, range=2..6))
cluster_4 = Cluster_2(T=rotate.Geometry, i=Slider(16, range=12..16))
merge = Merge(Data1=cluster, Data2=cluster_2, Data3=cluster_3, Data4=cluster_4)
travi = Data(flatten(dupln))

# ---- group: colonne
data_2 = Data(flatten(explode_3.Segments))

# ----
end = EndPoints(Curve=travi)  # -> Start, End
data_3 = Data(end.Start)
duppt = RemoveDuplicatePts(Points=data_3, Tolerance=0.01)

# ---- group: da MPa a KN/m2
multiplication = Multiplication(A=Slider(30000, range=0..100000), B="1000")

multiplication_2 = Multiplication(A=Slider(5000, range=0..100000), B="1000")

# ----
addition = Addition(A="0.3", B="2")

# ----
# nDMaterial
# ElasticIsotropic
python = GhPythonScript(E=multiplication, v="0.3", rho="25")  # -> out, nDMaterial
# ---------- python: Python ----------
"""
Create a support
-
    Args:
        name:
        E:
        G:
        v:
        rho:
    Returns:
        nDMaterial:
"""


import sys
import Rhino.Geometry as rg
import Grasshopper as gh
import copy


## add alpaca install directory to system path

ghcompfolder = gh.Folders.DefaultAssemblyFolder
if ghcompfolder not in sys.path:
    sys.path.append(ghcompfolder)

try:
    from Alpaca4d import alpaca4d as alpaca
except:
    msg = "Cannot import Alpaca4d. Is the Alpaca4d folder available in " + ghcompfolder + "?"
    ghenv.Component.AddRuntimeMessage(gh.Kernel.GH_RuntimeMessageLevel.Error, msg)


checkData = True

if not E:
    checkData = False
    msg = "Input parameter E failed to collect data"
    ghenv.Component.AddRuntimeMessage(gh.Kernel.GH_RuntimeMessageLevel.Warning, msg)

if not G and not v:
    checkData = False
    msg = "Input parameter G or v failed to collect data"
    ghenv.Component.AddRuntimeMessage(gh.Kernel.GH_RuntimeMessageLevel.Warning, msg)

if not rho:
    checkData = False
    msg = "Input parameter rho failed to collect data"
    ghenv.Component.AddRuntimeMessage(gh.Kernel.GH_RuntimeMessageLevel.Warning, msg)

if checkData:
    nDMaterial = alpaca.ElasticIsotropic(name, E, G, rho, v)
# ---------- end python ----------

division = Division(A=multiplication, B=addition)

# ----
# nDMaterial
# ElasticIsotropic
python_2 = GhPythonScript(E=multiplication, v="0.3", rho="25")  # -> out, nDMaterial; same code as python

area_2 = Area(Geometry=mesh_uv)  # -> Area, Centroid
lng_2 = ListLength(List=demesh.Vertices)
division_2 = Division(A=area_2.Area, B=lng_2)
multiplication_3 = Multiplication(A="-10", B=division_2)

division_3 = Division(A="25", B="9.81")

# ----
# Constant Time Series
python_3 = GhPythonScript(constantFactor="1")  # -> timeSeries, Graph
# ---------- python_3: Python ----------
"""
Create a PointLoad
-
    Args:
        tStart:
        tEnd:
        period:
        factor:
        shift:
    Returns:
        timeSeries:
        Graph:
"""

import sys
import Rhino.Geometry as rg
import Grasshopper as gh
import copy
import math


## add alpaca install directory to system path

ghcompfolder = gh.Folders.DefaultAssemblyFolder
if ghcompfolder not in sys.path:
    sys.path.append(ghcompfolder)

try:
    from Alpaca4d import alpaca4d as alpaca
except:
    msg = "Cannot import Alpaca4d. Is the Alpaca4d folder available in " + ghcompfolder + "?"
    ghenv.Component.AddRuntimeMessage(gh.Kernel.GH_RuntimeMessageLevel.Error, msg)

def ConstantSeries(x):
    return x



checkData = True

if not constantFactor:
    constantFactor = 1


if checkData:
    timeSeries = alpaca.TimeSeriesConstant(constantFactor)
    
    Graph = []
    
    for x in range(10):
        Graph.append(ConstantSeries(constantFactor))
# ---------- end python_3 ----------

# ----
# uniAxial
panel_2 = Panel("S235")
ghpython_script = GhPythonScript(name=panel_2, E=multiplication, eta=Slider(9.55, range=5..20), G=division, v="0.3", rho=division_3)  # -> out, steel
# ---------- ghpython_script: Python ----------
try:
    from Alpaca4d import alpaca4d as alpaca
except:
    msg = "Cannot import Alpaca4d. Is the Alpaca4d folder available in " + ghcompfolder + "?"
    ghenv.Component.AddRuntimeMessage(gh.Kernel.GH_RuntimeMessageLevel.Error, msg)

steel = alpaca.uniAxialMaterialElastic(name, E, Eneg, eta, G, v, rho)


print(steel.Eneg)



print(steel.write_tcl())
# ---------- end ghpython_script ----------

number_slider = Slider(0.5, range=0..1)
gs = GenericSectionAlpaca4d(
    Area="0.025",
    Izz="0.0000000001",
    Iyy="0.0000000001",
    J="0.0000000001",
    alphaY="0.5",
    alphaZ="0.5",
    material=ghpython_script.steel)  # -> out, Section
# ---------- gs: Python ----------
"""
Create a Generic Cross Section
-
    Args:
        secName:
        Area:
        Izz:
        Iyy:
        J:
        alphaY:
        alphaZ:
        material:
    Returns:
        genericSection:
"""

ghenv.Component.Name = "Generic Section (Alpaca4d)"
ghenv.Component.NickName = 'GS'
ghenv.Component.Message = "Generic Section (Alpaca4d)"

import sys
import Rhino.Geometry as rg
import Grasshopper as gh
import copy
import math as mt


## add alpaca install directory to system path

ghcompfolder = gh.Folders.DefaultAssemblyFolder
if ghcompfolder not in sys.path:
    sys.path.append(ghcompfolder)

try:
    from Alpaca4d import alpaca4d as alpaca
except:
    msg = "Cannot import Alpaca4d. Is the Alpaca4d folder available in " + ghcompfolder + "?"
    ghenv.Component.AddRuntimeMessage(gh.Kernel.GH_RuntimeMessageLevel.Error, msg)


checkData = True

if not Area:
    checkData = False
    msg = "Input parameter Area failed to collect data"
    ghenv.Component.AddRuntimeMessage(gh.Kernel.GH_RuntimeMessageLevel.Warning, msg)

if not Izz:
    checkData = False
    msg = "Input parameter Izz failed to collect data"
    ghenv.Component.AddRuntimeMessage(gh.Kernel.GH_RuntimeMessageLevel.Warning, msg)

if not Iyy:
    checkData = False
    msg = "Input parameter Iyy failed to collect data"
    ghenv.Component.AddRuntimeMessage(gh.Kernel.GH_RuntimeMessageLevel.Warning, msg)

if not J:
    checkData = False
    msg = "Input parameter J failed to collect data"
    ghenv.Component.AddRuntimeMessage(gh.Kernel.GH_RuntimeMessageLevel.Warning, msg)

if not alphaY:
    checkData = False
    msg = "Input parameter alphaY failed to collect data"
    ghenv.Component.AddRuntimeMessage(gh.Kernel.GH_RuntimeMessageLevel.Warning, msg)

if not alphaZ:
    checkData = False
    msg = "Input parameter alphaZ failed to collect data"
    ghenv.Component.AddRuntimeMessage(gh.Kernel.GH_RuntimeMessageLevel.Warning, msg)

if not material:
    checkData = False
    msg = "Input parameter material failed to collect data"
    ghenv.Component.AddRuntimeMessage(gh.Kernel.GH_RuntimeMessageLevel.Warning, msg)




if checkData:
    Section = alpaca.ElasticSection(secName, Area, Izz, Iyy, J, alphaY, alphaZ, material)
    d = 2*mt.sqrt(Area/mt.pi)
    Section.crv = rg.Circle(rg.Plane.WorldXY, d).ToNurbsCurve( 2, 10 )
    Section.sectionBrep = rg.Brep.CreatePlanarBreps( Section.crv, 0.1 )[0]
# ---------- end gs ----------
demesh_3 = DeconstructMesh(Mesh=item_2)  # -> Vertices, Faces, Colours, Normals
division_4 = Division(A=number_slider, B="2")
# PointLoad
panel_3 = Panel("10")
toggle = BooleanToggle(True)
vec = VectorXYZ(XComponent=panel_3, YComponent=0, ZComponent=multiplication_3)  # -> Vector, Length

# ----
# nDMaterial
# ElasticIsotropic
python_4 = GhPythonScript(E=multiplication_2, v="0.3", rho="25")  # -> out, nDMaterial; same code as python

circle_cross_section = CircleCrossSectionAlpaca4d(d=number_slider, t=division_4, material=ghpython_script.steel)  # -> out, CrossSection
# ---------- circle_cross_section: Python ----------
"""
Create a Circle Cross Section
-
    Args:
        secName:
        Area:
        Izz:
        Iyy:
        J:
        alphaY:
        alphaZ:
        material:
    Returns:
        genericSection:
"""


import sys
import Rhino.Geometry as rg
import Grasshopper as gh
import copy


## add alpaca install directory to system path

ghcompfolder = gh.Folders.DefaultAssemblyFolder
if ghcompfolder not in sys.path:
    sys.path.append(ghcompfolder)

try:
    from Alpaca4d import alpaca4d as alpaca
except:
    msg = "Cannot import Alpaca4d. Is the Alpaca4d folder available in " + ghcompfolder + "?"
    ghenv.Component.AddRuntimeMessage(gh.Kernel.GH_RuntimeMessageLevel.Error, msg)


checkData = True

if not d:
    checkData = False
    msg = "Input parameter d failed to collect data"
    ghenv.Component.AddRuntimeMessage(gh.Kernel.GH_RuntimeMessageLevel.Warning, msg)

if not t:
    checkData = False
    msg = "Input parameter t failed to collect data"
    ghenv.Component.AddRuntimeMessage(gh.Kernel.GH_RuntimeMessageLevel.Warning, msg)

if not material:
    checkData = False
    msg = "Input parameter material failed to collect data"
    ghenv.Component.AddRuntimeMessage(gh.Kernel.GH_RuntimeMessageLevel.Warning, msg)



if checkData:
    circleCS = alpaca.CircleCS(d,t,material)
    CrossSection = alpaca.ElasticSection(secName, circleCS.Area(), circleCS.Izz(), circleCS.Iyy(), circleCS.J(), circleCS.alphaY, circleCS.alphaZ, circleCS.material)
    CrossSection.sectionBrep = circleCS.sectionBrep
    CrossSection.crv = circleCS.crv
# ---------- end circle_cross_section ----------
rectangular_cross_section = RectangularCrossSectionAlpaca4d(b=Slider(0.3, range=0..1), h=Slider(0.7, range=0..1), material=ghpython_script.steel)  # -> out, CrossSection
# ---------- rectangular_cross_section: Python ----------
"""
Create a Rectangular Cross Section
-
    Args:
        secName:
        Area:
        Izz:
        Iyy:
        J:
        alphaY:
        alphaZ:
        material:
    Returns:
        genericSection:
"""


import sys
import Rhino.Geometry as rg
import Grasshopper as gh
import copy


## add alpaca install directory to system path

ghcompfolder = gh.Folders.DefaultAssemblyFolder
if ghcompfolder not in sys.path:
    sys.path.append(ghcompfolder)

try:
    from Alpaca4d import alpaca4d as alpaca
except:
    msg = "Cannot import Alpaca4d. Is the Alpaca4d folder available in " + ghcompfolder + "?"
    ghenv.Component.AddRuntimeMessage(gh.Kernel.GH_RuntimeMessageLevel.Error, msg)


checkData = True

if not b:
    checkData = False
    msg = "Input parameter b failed to collect data"
    ghenv.Component.AddRuntimeMessage(gh.Kernel.GH_RuntimeMessageLevel.Warning, msg)

if not h:
    checkData = False
    msg = "Input parameter h failed to collect data"
    ghenv.Component.AddRuntimeMessage(gh.Kernel.GH_RuntimeMessageLevel.Warning, msg)

if not material:
    checkData = False
    msg = "Input parameter material failed to collect data"
    ghenv.Component.AddRuntimeMessage(gh.Kernel.GH_RuntimeMessageLevel.Warning, msg)



if checkData:
    rectCS = alpaca.RectangularCS(b,h,material)
    CrossSection = alpaca.ElasticSection(secName, rectCS.Area(), rectCS.Izz(), rectCS.Iyy(), rectCS.J(), rectCS.alphaY, rectCS.alphaZ, rectCS.material)
    CrossSection.sectionBrep = rectCS.sectionBrep
    CrossSection.crv = rectCS.crv
# ---------- end rectangular_cross_section ----------
support = SupportAlpaca4d(Pos=demesh_3.Vertices, Tx=toggle, Ty=toggle, Tz=toggle, Rx=False, Ry=False, Rz=False)  # -> Support; inputs Pos: Point3d, Tx: Boolean, Ty: Boolean, Tz: Boolean, Rx: Boolean, Ry: Boolean, Rz: Boolean
# ---------- support: Python ----------
"""
Create a support
-
    Args:
        Pos:
        Tx:
        Ty:
        Tz:
        Rx:
        Ry:
    Returns:
        Support:
"""

ghenv.Component.Name = "Support (Alpaca4d)"
ghenv.Component.NickName = 'Support'
ghenv.Component.Message = "Support (Alpaca4d)"


import sys
import Rhino.Geometry as rg
import Grasshopper as gh


## add alpaca install directory to system path

ghcompfolder = gh.Folders.DefaultAssemblyFolder
if ghcompfolder not in sys.path:
    sys.path.append(ghcompfolder)

try:
    from Alpaca4d import alpaca4d as alpaca
except:
    msg = "Cannot import Alpaca4d. Is the Alpaca4d folder available in " + ghcompfolder + "?"
    ghenv.Component.AddRuntimeMessage(gh.Kernel.GH_RuntimeMessageLevel.Error, msg)

checkData = True


if not Pos:
    checkData = False
    msg = "Input parameter Pos failed to collect data"
    ghenv.Component.AddRuntimeMessage(gh.Kernel.GH_RuntimeMessageLevel.Warning, msg)

if checkData:
    Support = alpaca.Support(Pos, Tx, Ty, Tz, Rx, Ry, Rz)
# ---------- end support ----------
ghpython_script_2 = GhPythonScript(Line=merge, CrossSection=gs.Section, Colour=ColourSwatch(SwatchColor=RGB(195, 255, 0)))  # -> out, element; inputs Line: Curve, Colour: Color, Orient: Boolean
# ---------- ghpython_script_2: Python ----------
try:
    from Alpaca4d import alpaca4d as alpaca
except:
    msg = "Cannot import Alpaca4d. Is the Alpaca4d folder available in " + ghcompfolder + "?"
    ghenv.Component.AddRuntimeMessage(gh.Kernel.GH_RuntimeMessageLevel.Error, msg)
import copy


newCrossSection = copy.deepcopy(CrossSection)

if not Colour:
    Colour = Color.Red

if Orient is None:
    Orient = 0.0

element = alpaca.ForceBeamColumn(Line, newCrossSection, Colour, Orient)
# ---------- end ghpython_script_2 ----------
pl = PointLoadAlpaca4d(Pos=duppt, Force=vec.Vector, TimeSeries=python_3.timeSeries)  # -> out, PointLoad; inputs Pos: Point3d, Force: Vector3d, Moment: Vector3d
# ---------- pl: Python ----------
"""
Create a Point Load
-
    Args:
        Pos:
        Force:
        Moment:
        TimeSeries:
    Returns:
        PointLoad:
"""

ghenv.Component.Name = "Point Load (Alpaca4d)"
ghenv.Component.NickName = 'PL'
ghenv.Component.Message = "Point Load (Alpaca4d)"



import sys
import Rhino.Geometry as rg
import Grasshopper as gh
import copy


## add alpaca install directory to system path

ghcompfolder = gh.Folders.DefaultAssemblyFolder
if ghcompfolder not in sys.path:
    sys.path.append(ghcompfolder)

try:
    from Alpaca4d import alpaca4d as alpaca
except:
    msg = "Cannot import Alpaca4d. Is the Alpaca4d folder available in " + ghcompfolder + "?"
    ghenv.Component.AddRuntimeMessage(gh.Kernel.GH_RuntimeMessageLevel.Error, msg)


checkData = True

if not Pos:
    checkData = False
    msg = "Input parameter Pos failed to collect data"
    ghenv.Component.AddRuntimeMessage(gh.Kernel.GH_RuntimeMessageLevel.Warning, msg)

if not Force:
    Force = rg.Vector3d(0,0,0)

if not Moment:
    Moment = rg.Vector3d(0,0,0)

if not TimeSeries:
    checkData = False
    msg = "Input parameter TimeSeries failed to collect data"
    ghenv.Component.AddRuntimeMessage(gh.Kernel.GH_RuntimeMessageLevel.Warning, msg)


if checkData:
    PointLoad = alpaca.PointLoad(Pos, Force, Moment, TimeSeries)
# ---------- end pl ----------
refine = Refine(Mesh=item_2, Level=1)

number_slider_2 = Slider(2, range=0..10)  # disabled
number_slider_3 = Slider(3, range=0..10)  # disabled
cluster_5 = Cluster(M=refine, B=number_slider_2, N=10, N_2=number_slider_3, C=10)  # disabled

nv_2 = NakedVertices(Mesh=cluster_5)  # -> ClothedIndex, NakedIndex, ClothedPts, NakedPts; disabled
data_4 = Data(nv_2.NakedPts)  # disabled
data_5 = Data(cluster_5)  # disabled
item_3 = ListItem(List=data_5, Index=0, Wrap=True)  # -> Item1, Item; disabled
mstb = MeshSeriesToBrickAlpaca4d(MeshSeries=data_5)  # -> simplify(flatten(Brick)); inputs MeshSeries: list of Mesh; disabled
# ---------- mstb: Python ----------
"""Generate a Brick element from a list of mesh .
    the faces of the mesh '0' will be connected with the faces of the meshes '1' generating a brick element ( cube ).
    Attention : Each mesh in the list must have the same number of faces.
    Inputs:
        MeshSeries: quadMesh list with the same number of subdivisions .
    Output:
        Brick: Brick element --> Mesh with 6 faces and 8 nodes.
       """
import Rhino.Geometry as rg
import Grasshopper as gh

def MeshToShell(Mesh):
    
    Mesh.Unweld(0, True)
    mesh = Mesh.ExplodeAtUnweldedEdges()
    #print( len(mesh) )
    newMesh = []
    elementType = []
    for explodedMesh in mesh:
        newMesh.append(explodedMesh)
    return newMesh 

def brick( MeshList ):
    meshExpl = []
    Vertix = []
    elementType = []
    solid = []
    a = rg.Mesh.DuplicateMesh( MeshList[0] ) #.Unweld(0, True)
    a.Unweld(0, True)
    b = a.ExplodeAtUnweldedEdges()
    if len( b ) > 0 :
        for Mesh in MeshList:
            shellWrapper = MeshToShell(Mesh)
            meshExpl.append( shellWrapper )
        for index1 in range(0, len(MeshList)-1):
            for index2 in range(0, len(meshExpl[0])):
                if meshExpl[ index1 ][ index2 ].Vertices.Count == 4:
                    
                    elementType.append("stdBrick")
                    vertix1 = meshExpl[ index1 ][ index2 ].Vertices[0]
                    vertix2 = meshExpl[ index1 ][ index2 ].Vertices[1]
                    vertix3 = meshExpl[ index1 ][ index2 ].Vertices[2]
                    vertix4 = meshExpl[ index1 ][ index2 ].Vertices[3]
                    vertix5 = meshExpl[index1 + 1 ][ index2].Vertices[0]
                    vertix6 = meshExpl[index1 + 1 ][ index2].Vertices[1]
                    vertix7 = meshExpl[index1 + 1 ][ index2].Vertices[2]
                    vertix8 = meshExpl[index1 + 1 ][ index2].Vertices[3]
                    
                    vertix = [ vertix1, vertix2, vertix3, vertix4,
                    vertix5, vertix6, vertix7, vertix8 ]
                    
                    ele = rg.Mesh()
                    
                    ele.Vertices.Add( vertix1 ) # 0 
                    ele.Vertices.Add( vertix2 ) # 1
                    ele.Vertices.Add( vertix3 ) # 2
                    ele.Vertices.Add( vertix4 ) # 3
                    ele.Vertices.Add( vertix5 ) # 4
                    ele.Vertices.Add( vertix6 ) # 5
                    ele.Vertices.Add( vertix7 ) # 6
                    ele.Vertices.Add( vertix8 ) # 7
                    
                    ele.Faces.AddFace(0, 1, 2, 3) # 0
                    ele.Faces.AddFace(4, 5, 6, 7) # 1
                    ele.Faces.AddFace(0, 1, 5, 4) # 2
                    ele.Faces.AddFace(3, 2, 6, 7) # 3
                    ele.Faces.AddFace(1, 5, 6, 2) # 4
                    ele.Faces.AddFace(0, 4, 7, 3) # 5
                solid.append(ele)
                #ele.IsClosed()
                    
    else:
        for index1 in range(0, len(MeshList)-1):
            elementType.append("stdBrick")
            vertix1 = MeshList[ index1 ].Vertices[0]
            vertix2 = MeshList[ index1 ].Vertices[1]
            vertix3 = MeshList[ index1 ].Vertices[2]
            vertix4 = MeshList[ index1 ].Vertices[3]
            vertix5 = MeshList[index1 + 1 ].Vertices[0]
            vertix6 = MeshList[index1 + 1 ].Vertices[1]
            vertix7 = MeshList[index1 + 1 ].Vertices[2]
            vertix8 = MeshList[index1 + 1 ].Vertices[3]
            
            vertix = [ vertix1, vertix2, vertix3, vertix4,
            vertix5, vertix6, vertix7, vertix8 ]
            
            ele = rg.Mesh()
            
            ele.Vertices.Add( vertix1 ) # 0 
            ele.Vertices.Add( vertix2 ) # 1
            ele.Vertices.Add( vertix3 ) # 2
            ele.Vertices.Add( vertix4 ) # 3
            ele.Vertices.Add( vertix5 ) # 4
            ele.Vertices.Add( vertix6 ) # 5
            ele.Vertices.Add( vertix7 ) # 6
            ele.Vertices.Add( vertix8 ) # 7
            
            ele.Faces.AddFace(0, 1, 2, 3) # 0
            ele.Faces.AddFace(4, 5, 6, 7) # 1
            ele.Faces.AddFace(0, 1, 5, 4) # 2
            ele.Faces.AddFace(3, 2, 6, 7) # 3
            ele.Faces.AddFace(1, 5, 6, 2) # 4
            ele.Faces.AddFace(0, 4, 7, 3) # 5
            
            solid.append(ele)
            '''
            else :
                elementType.append(["FourNodeTetrahedron"]*3)
                
                if meshExpl[ index1 ][ index2 ].Vertices[0] == meshExpl[index1 + 1 ][ index2].Vertices[0] :
                    vertix1 = meshExpl[ index1 ][ index2 ].Vertices[0]
                    vertix2 = meshExpl[ index1 ][ index2 ].Vertices[1]
                    vertix3 = meshExpl[ index1 ][ index2 ].Vertices[2]
                    vertix4 = meshExpl[index1 + 1 ][ index2].Vertices[1]
                    vertix5 = meshExpl[index1 + 1 ][ index2].Vertices[2]
                    
                    vertixEle1 = [ vertix1, vertix2, vertix3, vertix4 ]
                    vertixEle2 = [ vertix1, vertix2, vertix3, vertix2 ]
                    
                    ele1 = rg.Mesh() # Tetrahedron 1
                    ele2 = rg.Mesh() # Tetrahedron 2
                    
                    ele1.Vertices.Add( vertix1 ) # 0 
                    ele1.Vertices.Add( vertix2 ) # 1
                    ele1.Vertices.Add( vertix3 ) # 2 
                    ele1.Vertices.Add( vertix4 ) # 3 
                    
                    ele1.VertexColors.Add(color)
                    ele1.VertexColors.Add(color)
                    ele1.VertexColors.Add(color)
                    ele1.VertexColors.Add(color)
                    
                    ele2.Vertices.Add( vertix1 ) # 0 
                    ele2.Vertices.Add( vertix2 ) # 1 
                    ele2.Vertices.Add( vertix3 ) # 2 
                    ele2.Vertices.Add( vertix2 ) # 3
    
                    ele2.VertexColors.Add(color)
                    ele2.VertexColors.Add(color)
                    ele2.VertexColors.Add(color)
                    ele2.VertexColors.Add(color)
                    
                    ele1.Faces.AddFace(0, 1, 4 ) # 0
                    ele1.Faces.AddFace(0, 1, 3 ) # 1
                    ele1.Faces.AddFace(0, 4, 3 ) # 2
                    ele1.Faces.AddFace(1, 3, 4 ) # 3
                    
                    ele2.Faces.AddFace(0, 1, 3 ) # 0
                    ele2.Faces.AddFace(0, 1, 2 ) # 1
                    ele2.Faces.AddFace(1, 2, 3 ) # 2
                    ele2.Faces.AddFace(0, 2, 3 ) # 3
                    
                    ele = [ ele1, ele2 ]
                    
                else :
                
                    vertix1 = meshExpl[ index1 ][ index2 ].Vertices[0]
                    vertix2 = meshExpl[ index1 ][ index2 ].Vertices[1]
                    vertix3 = meshExpl[ index1 ][ index2 ].Vertices[2]
                    vertix4 = meshExpl[index1 + 1 ][ index2].Vertices[0]
                    vertix5 = meshExpl[index1 + 1 ][ index2].Vertices[1]
                    vertix6 = meshExpl[index1 + 1 ][ index2].Vertices[2]
                    
                    vertixEle1 = [ vertix1, vertix2, vertix3, vertix6 ]
                    vertixEle2 = [ vertix4, vertix5, vertix6, vertix1 ]
                    vertixEle3 = [ vertix5, vertix6, vertix2, vertix1 ]
                    
                    vertix = [ vertixEle1, vertixEle2, vertixEle3 ]
                    
                    ele1 = rg.Mesh() # Tetrahedron 1
                    ele2 = rg.Mesh() # Tetrahedron 2
                    ele3 = rg.Mesh() # Tetrahedron 3
                    
                    ele1.Vertices.Add( vertix1 ) # 0 
                    ele1.Vertices.Add( vertix2 ) # 1
                    ele1.Vertices.Add( vertix3 ) # 2 
                    ele1.Vertices.Add( vertix6 ) # 3 
                    
                    ele1.VertexColors.Add(color)
                    ele1.VertexColors.Add(color)
                    ele1.VertexColors.Add(color)
                    ele1.VertexColors.Add(color)
                    
                    ele2.Vertices.Add( vertix4 ) # 0 
                    ele2.Vertices.Add( vertix5 ) # 1 
                    ele2.Vertices.Add( vertix6 ) # 2 
                    ele2.Vertices.Add( vertix1 ) # 3
    
                    ele2.VertexColors.Add(color)
                    ele2.VertexColors.Add(color)
                    ele2.VertexColors.Add(color)
                    ele2.VertexColors.Add(color)
                    
                    ele3.Vertices.Add( vertix5 ) # 0 
                    ele3.Vertices.Add( vertix6 ) # 1 
                    ele3.Vertices.Add( vertix2 ) # 2 
                    ele3.Vertices.Add( vertix1 ) # 3
                    
                    ele3.VertexColors.Add(color)
                    ele3.VertexColors.Add(color)
                    ele3.VertexColors.Add(color)
                    ele3.VertexColors.Add(color)
                    
                    ele1.Faces.AddFace(0, 1, 2 ) # 0
                    ele1.Faces.AddFace(0, 3, 1 ) # 1
                    ele1.Faces.AddFace(0, 3, 2 ) # 2
                    ele1.Faces.AddFace(1, 3, 2 ) # 3
                    
                    ele2.Faces.AddFace(0, 1, 2 ) # 0
                    ele2.Faces.AddFace(0, 3, 1 ) # 1
                    ele2.Faces.AddFace(0, 3, 2 ) # 2
                    ele2.Faces.AddFace(1, 3, 2 ) # 3
                    
                    ele3.Faces.AddFace(0, 1, 2 ) # 0
                    ele3.Faces.AddFace(0, 3, 1 ) # 1
                    ele3.Faces.AddFace(0, 3, 2 ) # 2
                    ele3.Faces.AddFace(1, 3, 2 ) # 3
                    
                    ele = [ ele1, ele2, ele3 ]
            
            solid.append(ele)
            Vertix.append( vertix )
            '''
    return solid

checkData = True

if not MeshSeries or len(MeshSeries) == 1 :  #is not None:
    checkData = False
    msg = "input 'MeshSeries' failed to collect data"
    ghenv.Component.AddRuntimeMessage( gh.Kernel.GH_RuntimeMessageLevel.Warning, msg )

if checkData != False:
    Brick= brick( MeshSeries )
# ---------- end mstb ----------
mstb_2 = MeshSeriesToBrickAlpaca4d(MeshSeries=cluster_5)  # -> simplify(flatten(Brick)); inputs MeshSeries: list of Mesh; disabled; same code as mstb
demesh_4 = DeconstructMesh(Mesh=item_3.Item1)  # -> Vertices, Faces, Colours, Normals; disabled
merge_2 = Merge(Data1=data_4, Data2=demesh_4.Vertices)  # disabled

# ---- group: terreno
data_6 = Data([mstb_2, mstb])  # disabled

# ---- group: Support
data_7 = Data(merge_2)  # disabled

# ----
pfs = PlateFiberAlpaca4d(thickness="1", nDMaterial=python.nDMaterial)  # -> out, Section
# ---------- pfs: Python ----------
"""
Create a Plate Fiber Section
-
    Args:
        secName:
        thickness:
        nDMaterial:
    Returns:
        Section:
"""


import sys
import Rhino.Geometry as rg
import Grasshopper as gh
import copy

ghenv.Component.Name = "Plate Fiber (Alpaca4d)"
ghenv.Component.NickName = 'PFS'
ghenv.Component.Message = "Plate Fiber (Alpaca4d)"


## add alpaca install directory to system path

ghcompfolder = gh.Folders.DefaultAssemblyFolder
if ghcompfolder not in sys.path:
    sys.path.append(ghcompfolder)

try:
    from Alpaca4d import alpaca4d as alpaca
except:
    msg = "Cannot import Alpaca4d. Is the Alpaca4d folder available in " + ghcompfolder + "?"
    ghenv.Component.AddRuntimeMessage(gh.Kernel.GH_RuntimeMessageLevel.Error, msg)


checkData = True

if not thickness:
    checkData = False
    msg = "Input parameter thickness failed to collect data"
    ghenv.Component.AddRuntimeMessage(gh.Kernel.GH_RuntimeMessageLevel.Warning, msg)

if not nDMaterial:
    checkData = False
    msg = "Input parameter nDMaterial failed to collect data"
    ghenv.Component.AddRuntimeMessage(gh.Kernel.GH_RuntimeMessageLevel.Warning, msg)

if checkData:
    Section = alpaca.PlateFiberSection(secName, thickness, nDMaterial)
# ---------- end pfs ----------
swatch = ColourSwatch(SwatchColor=RGB(163, 104, 104))  # disabled
ssp = SSPBrickAlpaca4d(Brick=data_6, nDMaterial=python_4.nDMaterial, Colour=swatch)  # -> out, Element; inputs Brick: Mesh, Colour: Color; disabled
# ---------- ssp: Python ----------
"""
Create a Stabilized Single Point Brick (SSPbrick)
-
    Args:
        Brick:
        nDMaterial:
        Colour:
    Returns:
        element:
"""

ghenv.Component.Name = "SSP brick (Alpaca4d)"
ghenv.Component.NickName = 'SSP'
ghenv.Component.Message = "SSP brick (Alpaca4d)"


import sys
import Rhino.Geometry as rg
import Grasshopper as gh
import copy
from System.Drawing import Color

## add alpaca install directory to system path

ghcompfolder = gh.Folders.DefaultAssemblyFolder
if ghcompfolder not in sys.path:
    sys.path.append(ghcompfolder)

try:
    from Alpaca4d import alpaca4d as alpaca
    from Alpaca4d import alpaca4dUtil as alpacaUtil
except:
    msg = "Cannot import Alpaca4d. Is the Alpaca4d folder available in " + ghcompfolder + "?"
    ghenv.Component.AddRuntimeMessage(gh.Kernel.GH_RuntimeMessageLevel.Error, msg)


checkData = True

if not Brick:
    checkData = False
    msg = "Input parameter Brick failed to collect data"
    ghenv.Component.AddRuntimeMessage(gh.Kernel.GH_RuntimeMessageLevel.Warning, msg)

if not nDMaterial:
    checkData = False
    msg = "Input parameter nDMaterial failed to collect data"
    ghenv.Component.AddRuntimeMessage(gh.Kernel.GH_RuntimeMessageLevel.Warning, msg)

if not Colour:
    Colour = Color.OrangeRed


if checkData:
    Brick = alpacaUtil.cleanHexahedron(Brick)
    Element = alpaca.SSPbrick(Brick,copy.deepcopy(nDMaterial), Colour)
# ---------- end ssp ----------
ghpython_script_3 = GhPythonScript(Line=data_2, CrossSection=circle_cross_section.CrossSection, Colour=ColourSwatch(SwatchColor=RGB(153, 11, 11)))  # -> out, element; inputs Line: Curve, Colour: Color, Orient: Boolean; same code as ghpython_script_2
asd = ASDShellQ4Alpaca4d(Mesh=refine, Section=pfs.Section)  # -> out, Element; inputs Mesh: Mesh, Colour: Color
# ---------- asd: Python ----------
"""
Create a ASDShellQ4 element
-
    Args:
        Mesh:
        Section:
        Colour:
    Returns:
        Element:
"""

ghenv.Component.Name = "ASD ShellQ4 (Alpaca4d)"
ghenv.Component.NickName = 'ASD'
ghenv.Component.Message = "ASD ShellQ4 (Alpaca4d)"



import sys
import Rhino.Geometry as rg
import Grasshopper as gh
import copy
from System.Drawing import Color


## add alpaca install directory to system path

ghcompfolder = gh.Folders.DefaultAssemblyFolder
if ghcompfolder not in sys.path:
    sys.path.append(ghcompfolder)

try:
    from Alpaca4d import alpaca4d as alpaca
except:
    msg = "Cannot import Alpaca4d. Is the Alpaca4d folder available in " + ghcompfolder + "?"
    ghenv.Component.AddRuntimeMessage(gh.Kernel.GH_RuntimeMessageLevel.Error, msg)


checkData = True

if not Mesh:
    checkData = False
    msg = "Input parameter Mesh failed to collect data"
    ghenv.Component.AddRuntimeMessage(gh.Kernel.GH_RuntimeMessageLevel.Warning, msg)

if not Section:
    checkData = False
    msg = "Input parameter Section failed to collect data"
    ghenv.Component.AddRuntimeMessage(gh.Kernel.GH_RuntimeMessageLevel.Warning, msg)

if not Colour:
    Colour = Color.Blue


if checkData:
    
    Mesh.Unweld(0,True)
    explodedMesh = Mesh.ExplodeAtUnweldedEdges()
    if explodedMesh.Length > 0:
        Element = []
        for mesh in explodedMesh:
            if mesh.Vertices.Count == 4:
                Element.append(alpaca.ASDShellQ4(mesh, copy.deepcopy(Section), Colour))
            elif mesh.Vertices.Count == 3:
                Element.append(alpaca.ShellNLDKGT(mesh, copy.deepcopy(Section), Colour))
    elif explodedMesh.Length == 0:
        if Mesh.Vertices.Count == 4:
                Element = alpaca.ASDShellQ4(Mesh, copy.deepcopy(Section), Colour)
        elif Mesh.Vertices.Count == 3:
            Element = alpaca.ShellNLDKGT(Mesh, copy.deepcopy(Section), Colour)
# ---------- end asd ----------
ghpython_script_4 = GhPythonScript(Line=travi, CrossSection=rectangular_cross_section.CrossSection, Colour=ColourSwatch(SwatchColor=RGB(255, 223, 64)))  # -> out, flatten(element); inputs Line: Curve, Colour: Color, Orient: Boolean; same code as ghpython_script_2
am = AssembleModelAlpaca4d(
    Element=flatten([ghpython_script_4.element, ghpython_script_3.element, ghpython_script_2.element]),
    Support=flatten(support),
    Load=flatten(pl.PointLoad))  # -> out, AlpacaModel, Mass; inputs Element: list, Support: list, Load: list, Constraint: list
# ---------- am: Python ----------
"""
Create a FEA Model
-
    Args:
        Element:
        Support:
        Load:
        Constraint:
    Returns:
        AlpacaModel:
"""

ghenv.Component.Name = "Assemble Model (Alpaca4d)"
ghenv.Component.NickName = 'AM'
ghenv.Component.Message = "Assemble Model (Alpaca4d)"




import os
from Alpaca4d import alpaca4d as alpaca
import ghpythonlib.treehelpers as th
import Rhino.Geometry as rg
import Rhino.Collections as rc
import rhinoscriptsyntax as rs
from collections import defaultdict, OrderedDict
import copy
import time



FolderPath = rs.DocumentPath()
os.chdir(FolderPath)

# create the object model
AlpacaModel = alpaca.Model()


start = time.clock()
#subdivide element per type

for element in Element:
    if element.type == "Beam":
        AlpacaModel.beams.append(element)
    elif element.type == "Shell":
        AlpacaModel.shells.append(element)
    elif element.type == "Brick":
        AlpacaModel.bricks.append(element)

end = time.clock() - start
print("time to subdivide element {}".format(end))
start = time.clock()

# create a list of unique point
# need to add the rigid constraint

AlpacaModel.getuniquePoints(AlpacaModel.beams, AlpacaModel.shells, AlpacaModel.bricks, AlpacaModel.constraints)


end = time.clock() - start
print("time to get uniquepoints {}".format(end))
start = time.clock()


#############
# create node and assign to object
#############

if AlpacaModel.uniquePointsThreeNDF:
    AlpacaModel.py.append(alpaca.Model.write3ndf_tcl())
    for point in AlpacaModel.uniquePointsThreeNDF:
        node = alpaca.Node(point)
        node.ndf = 3
        node.setNodeTag(AlpacaModel)
        AlpacaModel.nodes.append( node )
    
        AlpacaModel.py.append(node.write_tcl())


if AlpacaModel.uniquePointsSixNDF:
    AlpacaModel.py.append(alpaca.Model.write6ndf_tcl())
    for point in AlpacaModel.uniquePointsSixNDF:
        node = alpaca.Node(point)
        node.ndf = 6
        node.setNodeTag(AlpacaModel)
        AlpacaModel.nodes.append( node )
     
        AlpacaModel.py.append(node.write_tcl())



end = time.clock() - start
print("time to create node and assign tag {}".format(end))
start = time.clock()


#################
# create supports
#################

for supportNode in Support:
    
    # if the list is empty, skip this operation
    if AlpacaModel.uniquePointsThreeNDF:
        closestPointInThreeNDF = rc.Point3dList.ClosestPointInList(AlpacaModel.uniquePointsThreeNDF, supportNode.Pos)
        if supportNode.Pos.DistanceTo(closestPointInThreeNDF) < 0.001:
            #print("I am in 3ndf")
            supportNode.ndf = 3
            AlpacaModel.threeNDFModel.append(supportNode)
            supportNode.setNodeTag(AlpacaModel)
    
    if AlpacaModel.uniquePointsSixNDF:
        closestPointInSixNDF = rc.Point3dList.ClosestPointInList(AlpacaModel.uniquePointsSixNDF, supportNode.Pos)
        if supportNode.Pos.DistanceTo(closestPointInSixNDF) < 0.001:
            supportNode.ndf = 6
            AlpacaModel.sixNDFModel.append(supportNode)
            supportNode.setNodeTag(AlpacaModel)
    
    
    AlpacaModel.supports.append(supportNode)
    AlpacaModel.py.append(supportNode.write_tcl())


end = time.clock() - start
print("time to create support and assign tag {}".format(end))
start = time.clock()


####################
# create constraints
####################


for constraint in Constraint:
    constraint.setNodeTag(AlpacaModel)
    AlpacaModel.constraints.append(constraint)

####################
# create equalDOF when the model has 3df and 6df together
####################


end = time.clock() - start
print("time to create constraint and assign tag {}".format(end))
start = time.clock()


Id = []
IdB = []

def SearchCallback(sender, e):
    Id.Add(e.Id)
    IdB.Add(e.IdB)



lenThreeNDF = len(AlpacaModel.uniquePointsThreeNDF)
lenSixNDF = len(AlpacaModel.uniquePointsSixNDF)


if not(lenThreeNDF == 0 or lenSixNDF == 0):
    print("brick and beam together")
    rg.RTree.SearchOverlaps(AlpacaModel.RTreeCloudPointThreeNDF, AlpacaModel.RTreeCloudPointSixNDF, 0.001, SearchCallback)
    
    for i,j in zip(Id, IdB):
        print(i,j)
        node_i = AlpacaModel.uniquePointsThreeNDF[i]
        node_j = AlpacaModel.uniquePointsSixNDF[j]
        
        #index_i = AlpacaModel.cloudPoint.ClosestPoint(node_i) + 1
        #index_j = AlpacaModel.cloudPoint.ClosestPoint(node_j) + 1
        
        equalConstraint = alpaca.EqualDOF(node_i, node_j, True, True, True, False, False, False)
        equalConstraint.masterNodeTag = AlpacaModel.cloudPointThreeNDF.ClosestPoint(node_i) + 1
        equalConstraint.slaveNodesTag = AlpacaModel.cloudPointSixNDF.ClosestPoint(node_j) + 1 + len(AlpacaModel.uniquePointsThreeNDF)
        AlpacaModel.py.append(equalConstraint.write_tcl())



end = time.clock() - start
print("time to find common points between 3ndf and 6ndf {}".format(end))
start = time.clock()


# write py file


# assign tag and node Index to element and shell
for index, element in enumerate(Element,1):
    element.setTopologyRTree(AlpacaModel)
    element.eleTag = index
    element.setTags()



end = time.clock() - start
print("time to assign tags for the elements {}".format(end))
start = time.clock()



Mass = 0
IsGravity = False

for item in Load:
    if item.type == "Gravity Load":
        IsGravity = True
        GravityLoad = item
    if item.type == "PointLoad":
        AlpacaModel.loads.append(item)


for item in Element:
    if item.type == "Beam":
        length = item.Crv.GetLength()
        Mass += (item.massDens * length)
        if IsGravity:
            gravityPointLoad = alpaca.PointLoad(item.Crv.PointAtStart, rg.Vector3d(0,0, -(item.massDens * length / 2)) * GravityLoad.GravityFactor, rg.Vector3d(0,0,0), GravityLoad.TimeSeries)
            #print( -(item.massDens * length / 2))
            AlpacaModel.loads.append(gravityPointLoad)
    if item.type == "Shell":
        meshArea = rg.AreaMassProperties.Compute(item.Mesh).Area
        areaDensity = item.CrossSection.height * item.CrossSection.material.rho
        Mass += areaDensity * meshArea
        if IsGravity:
            for vertex in item.Mesh.Vertices.ToPoint3dArray():
                gravityPointLoad = alpaca.PointLoad(vertex, rg.Vector3d(0,0, -(areaDensity * meshArea/ len(item.Mesh.Vertices))) * GravityLoad.GravityFactor, rg.Vector3d(0,0,0), GravityLoad.TimeSeries)
                AlpacaModel.loads.append(gravityPointLoad)
    if item.type == "Brick":
        #print(type(item.Mesh))
        meshVolume = rg.VolumeMassProperties.Compute(item.Mesh).Volume
        density = item.material.rho 
        Mass += density * meshVolume
        if IsGravity:
            for vertex in item.Mesh.Vertices.ToPoint3dArray():
                gravityPointLoad = alpaca.PointLoad(vertex, rg.Vector3d(0,0, -(density * meshVolume / len(item.Mesh.Vertices))) * GravityLoad.GravityFactor, rg.Vector3d(0,0,0), GravityLoad.TimeSeries)
                #print(len(item.Mesh.Vertices))
                #print(density)
                # volume can be zero if mesh faces are not properly rotated
                #print(meshVolume)
                #print(-(density * meshVolume / len(item.Mesh.Vertices)))
                AlpacaModel.loads.append(gravityPointLoad)

#print(AlpacaModel.loads)
## load

for item in AlpacaModel.loads:
    item.setNodeTag(AlpacaModel)

#print(AlpacaModel.loads)

for item in AlpacaModel.beams:
    AlpacaModel.py.append(item.write_tcl())

for item in AlpacaModel.shells:
    AlpacaModel.py.append(item.write_tcl())

for item in AlpacaModel.bricks:
    AlpacaModel.py.append(item.write_tcl())


for item in Constraint:
    AlpacaModel.py.append(item.write_tcl())


timeSeriesDict = alpaca.TimeSeries.getTimeSeries(AlpacaModel.loads)[1]
AlpacaModel.py.append(alpaca.PointLoad.write_tcl(timeSeriesDict,AlpacaModel))
# ---------- end am ----------
toggle_2 = BooleanToggle(True)  # disabled
vm = ViewModelAlpaca4d(AlpacaModel=am.AlpacaModel, type=toggle_2)  # inputs type: Boolean, nodeTag: Boolean, eleTag: Boolean, localAxis: Boolean, support: Boolean, load: Boolean; disabled
# ---------- vm: Python ----------
"""View structural Model
    Inputs:
        AlpacaModel: Output of Assemble Model.
        type: Style of visualize Model 
Default: Visualize the stick Model
True: Visualize the extrude Model
        nodeTag: 
True: Visualize tag nodes
        eleTag: 
True: Visualize tag elements 
        LocalAxes:
True: Visualize local Axis of elements 
        Support: 
True: Visualize support type
        Load: 
True: Visualize load
"""


from ghpythonlib.componentbase import executingcomponent as component
import Grasshopper, GhPython
import System
import ghpythonlib.components as ghcomp

import Rhino as rc
import rhinoscriptsyntax as rs
import sys
import Rhino.Geometry as rg
import Grasshopper as gh
import copy

ghenv.Component.Name = "View Model (Alpaca4d)"
ghenv.Component.NickName = 'VM'
ghenv.Component.Message = "View Model (Alpaca4d)"

ghcompfolder = gh.Folders.DefaultAssemblyFolder
if ghcompfolder not in sys.path:
    sys.path.append(ghcompfolder)
try:
    from Alpaca4d import alpaca4dView as alpacaView
except:
    msg = "Cannot import Alpaca4d. Is the Alpaca4d folder available in " + ghcompfolder + "?"
    ghenv.Component.AddRuntimeMessage(gh.Kernel.GH_RuntimeMessageLevel.Error, msg)

checkData = True

class MyComponent(component):
    
    def RunScript(self, AlpacaModel, type, nodeTag, eleTag, localAxis, support, load):
        
        
        self.ModelBeam = []
        self.ModelShell = []
        self.ModelBrick = []
        self.Nodes = []
        self.TagEle = []
        self.localAxis = []
        self.solidSupport = []
        self.viewLoad = []
        
        if not AlpacaModel:
            checkData = False
            msg = "Input parameter AlpacaModel failed to collect data"
            ghenv.Component.AddRuntimeMessage(gh.Kernel.GH_RuntimeMessageLevel.Warning, msg)
        else:
            self.type = type
            
            ## add alpaca install directory to system path
            
            self.ModelBeam = alpacaView.ViewBeam( AlpacaModel, type)
            self.ModelShell = alpacaView.ViewShell( AlpacaModel, type )
            self.ModelBrick = alpacaView.ViewBrick( AlpacaModel)
            #NODE TAG VIEW
            if nodeTag is True:
                self.Nodes = [ [inode.nodeTag, inode.Pos] for inode in AlpacaModel.nodes]
            else:
                self.Nodes = []
            #ELE TAG VIEW
            if eleTag is True:
                TagBeam = [ [item.eleTag, item.getPerpFrame().Origin] for item in AlpacaModel.beams]
                TagShell = [ [item.eleTag, rg.AreaMassProperties.Compute( item.Mesh, False, True, False, False ).Centroid] for item in AlpacaModel.shells]
                TagBrick = [ [item.eleTag, rg.AreaMassProperties.Compute( item.Mesh, False, True, False, False ).Centroid] for item in AlpacaModel.bricks]
                self.TagEle = TagBeam + TagShell + TagBrick
            else:
                self.TagEle = []
            #LOCAL AXIS
            if localAxis is True:
                self.localAxis = [ item.getPerpFrame() for item in AlpacaModel.beams]
            else:
                self.localAxis = []
            #SUPPORT
            if support is True:
                scale = 0.5
                self.solidSupport = [ alpacaView.Support( iSupport, scale ) for iSupport in AlpacaModel.supports ]
            else:
                self.solidSupport = []
            # LOAD
            if load is True:
                self.viewLoad =[[item.Pos, item.Force, item.Moment] for item in AlpacaModel.loads]
            else:
                self.viewLoad = []
            self.forceBounds = ghcomp.Bounds([ item[1] for item in self.viewLoad])
            self.momentBounds = ghcomp.Bounds([ item[2] for item in self.viewLoad])

    def DrawViewportWires(self,arg):
        # Beam
        for iBeam in self.ModelBeam:
            color = iBeam[1]
            colorMaterial = rc.Display.DisplayMaterial(color, 0.3)
            if self.type is True:
                colorWirframe = System.Drawing.Color.Gray
                #System.Drawing.Color.LightGray
                arg.Display.DrawBrepShaded(iBeam[0], colorMaterial)
                arg.Display.DrawBrepWires(iBeam[0], colorWirframe)
            else :
                thickness =2
                arg.Display.DrawCurve(iBeam[0], color, thickness)
        # Mesh
        for iShell in self.ModelShell:
            color = iShell[1]
            #color = System.Drawing.Color.Blue
            colorMaterial = rc.Display.DisplayMaterial(color,color,color,color,1,0.30)
            colorMaterial.IsTwoSided = False
            arg.Display.DrawMeshShaded(iShell[0], colorMaterial)
            colorWirframe = System.Drawing.Color.Black
            arg.Display.DrawMeshWires(iShell[0], colorWirframe)
        #Brick 
        for iBrick in self.ModelBrick:
            color = iBrick[1]
            #color = System.Drawing.Color.Blue
            colorMaterial = rc.Display.DisplayMaterial(color,color,color,color,1,0.30)
            colorMaterial.IsTwoSided = False
            arg.Display.DrawMeshShaded(iBrick[0], colorMaterial)
            colorWirframe = System.Drawing.Color.Black
            arg.Display.DrawMeshWires(iBrick[0], colorWirframe)
            
        # node Tag view
        for inode in self.Nodes:
            arg.Display.Draw2dText( str(inode[0]), System.Drawing.Color.DarkSlateBlue, inode[1], True, 50)
        # ele Tag view
        for iEle in self.TagEle:
            arg.Display.Draw2dText( str(iEle[0]), System.Drawing.Color.BlanchedAlmond, iEle[1], True, 50)
        # local Axis
        for iLocalAxis in self.localAxis:
            arg.Display.DrawArrow( rg.Line(iLocalAxis.Origin, iLocalAxis.XAxis), System.Drawing.Color.Red)
            arg.Display.DrawArrow( rg.Line(iLocalAxis.Origin, iLocalAxis.YAxis), System.Drawing.Color.Green)
            arg.Display.DrawArrow( rg.Line(iLocalAxis.Origin, iLocalAxis.ZAxis), System.Drawing.Color.Blue)
            
        color = System.Drawing.Color.Azure
        colorWirframe = System.Drawing.Color.Black
        colorMaterial = rc.Display.DisplayMaterial(color, 0.0)
        for iSupport in self.solidSupport :
            arg.Display.DrawBrepShaded( iSupport, colorMaterial)
            arg.Display.DrawBrepWires( iSupport, colorWirframe)
            
        for iLoad in self.viewLoad:
            arg.Display.DrawArrow( rg.Line(iLoad[0], iLoad[1]/self.forceBounds[1]) ,  System.Drawing.Color.DarkRed)
            arg.Display.DrawArrow( rg.Line(iLoad[0], iLoad[2]/self.momentBounds[1]) ,  System.Drawing.Color.DarkBlue)
# ---------- end vm ----------
as = AnalysisSettingsAlpaca4d(Constraint="Plain", Numberer="Plain", System="BandGen", Algorithm="KrylovNewton", AnalysisSteps="1")  # -> out, Analysis
# ---------- as: Python ----------
"""
Create Analysis settings
-
    Args:
        Constraint: 'Plain', 'Transformation'. Default is 'Transformation'.
        Numberer: 'RCM', 'AMD', 'Plain'. Default is 'RCM'.
        System: 'BandGen', 'BandSPD', 'ProfileSPD', 'SuperLU', 'UmfPack', 'FullGeneral', 'SparseSYM'. Default is 'BandSPD'.
        Test: Feature not implemented. Please contact alpaca4d@gmail.com 
        Algorithm: 'Linear', 'Newton', 'NewtonLineSearch', 'ModifiedNewton', 'KrylovNewton', 'SecantNewton', 'BFGS', 'Broyden'. Default is 'Linear'.
        Integrator: Default is LoadControl.
        AnalysisType: 'Static', 'Transient'. Default is 'Static'.
        AnalyesSteps:
    Returns:
        Analysis:
"""

import sys
import os


import clr
import clrtype
import Rhino.Geometry as rg
import rhinoscriptsyntax as rs
import Grasshopper as gh
import copy
import ghpythonlib.treehelpers as th


ghenv.Component.Name = "Analysis settings (Alpaca4d)"
ghenv.Component.NickName = 'AS'
ghenv.Component.Message = "Analysis settings \n(Alpaca4d)"



from Alpaca4d import alpaca4d as alpaca

checkData = True


# default Value
Constraint = 'Transformation' if Constraint is None else Constraint
ConstraintList = ['Plain', 'Transformation']

for item in ConstraintList:
    if Constraint.lower() == item.lower():
        print(item)
        Constraint = item


# default Value
Numberer = 'RCM' if Numberer is None else Numberer
NumbererList = ['RCM', 'AMD', 'Plain', 'ParallelPlain', 'ParallelRCM']

for i,item in enumerate(NumbererList):
    if Numberer.lower() == item.lower():
        Numberer = item



# default Value
System = 'BandSPD' if System is None else System
SystemList = ['BandGen', 'BandSPD', 'ProfileSPD', 'SuperLU', 'UmfPack', 'FullGeneral', 'SparseSYM']

for i,item in enumerate(SystemList):
    if System.lower() == item.lower():
        System = item


# default Test
Test = 'NormDispIncr 1.0e-6 12 5' if Test is None else Test




# default Value
Algorithm = 'Linear' if Algorithm is None else Algorithm
AlgorithmList = ['Linear', 'Newton', 'NewtonLineSearch', 'ModifiedNewton', 'KrylovNewton', 'SecantNewton', 'BFGS', 'Broyden']

for i,item in enumerate(AlgorithmList):
    if Algorithm.lower() == item.lower():
        Algorithm = item


# default Value
AnalysisType = 'Static' if AnalysisType is None else AnalysisType
AnalysisTypeList = ['Static', 'Transient']

for item in AnalysisTypeList:
    if AnalysisType.lower() == item.lower():
        AnalysisType = item


## Define Integrator
if AnalysisType == "Static":
    Integrator = "LoadControl 1.0" if Integrator is None else Integrator
elif AnalysisType == "Transien":
    Integrator = "Newmark 0.5 0.25" if Integrator is None else Integrator



if not AnalysisSteps:
    checkData = False
    msg = "Input parameter AnalysisSteps failed to collect data"
    ghenv.Component.AddRuntimeMessage(gh.Kernel.GH_RuntimeMessageLevel.Warning, msg)


if checkData:
    Analysis = alpaca.Analysis(Constraint, Numberer,System,Test,Algorithm,Integrator,AnalysisType, AnalysisSteps)
    print(Analysis.write_tcl())
# ---------- end as ----------
ra = RunAnalysisAlpaca4d(AlpacaModel=am.AlpacaModel, Settings=as.Analysis)  # -> log, AlpacaSolvedModel
# ---------- ra: Python ----------
"""
Run an OpenSees Analysis
-
    Args:
        AlpacaModel:
        Settings:
    Returns:
        AlpacaSolvedModel:
"""



import Rhino.RhinoDoc
import Grasshopper as gh
import copy
import rhinoscriptsyntax as rs
import os
import time
import sys



ghenv.Component.Name = "Run Analysis (Alpaca4d)"
ghenv.Component.NickName = 'RA'
ghenv.Component.Message = "Run Analysis (Alpaca4d)"

ghcompfolder = gh.Folders.DefaultAssemblyFolder
if ghcompfolder not in sys.path:
    sys.path.append(ghcompfolder)

try:
    from Alpaca4d import alpaca4d as alpaca
except:
    msg = "Cannot import Alpaca4d. Is the Alpaca4d folder available in " + ghcompfolder + "?"
    ghenv.Component.AddRuntimeMessage(gh.Kernel.GH_RuntimeMessageLevel.Error, msg)


checkData = True



if not AlpacaModel:
    checkData = False
    msg = "Input parameter AlpacaModel failed to collect data"
    ghenv.Component.AddRuntimeMessage(gh.Kernel.GH_RuntimeMessageLevel.Warning, msg)


if not Settings:
    checkData = False
    msg = "Input parameter Settings failed to collect data"
    ghenv.Component.AddRuntimeMessage(gh.Kernel.GH_RuntimeMessageLevel.Warning, msg)


if checkData:
    FolderPath = rs.DocumentPath()
    os.chdir(FolderPath)
    
    outputFileName = 'openSeesModel'
    recorderFileName = 'recorder.mpco'
    
    for dirpath, dirnames, filenames in os.walk(FolderPath):
        for filename in filenames:
            if filename == outputFileName:
                file = os.path.join(dirpath,outputFileName)
                os.remove(file)
            elif filename == recorderFileName:
                file = os.path.join(dirpath,recorderFileName)
                os.remove(file)
    
    
    # create a copy
    
    AnalysisModel = copy.copy(AlpacaModel)
    AnalysisModel.py = list(AnalysisModel.py)
    
    # generate Recorder and assign name
    AnalysisModel.recorderName = "recorder" + ".mpco"
    
    AnalysisModel.py.append(alpaca.TCLRecorder.mpco(AnalysisModel.recorderName, True,True,True,True,False,False,True,True,True,True))
    
    
    AnalysisModel.analysis = Settings
    AnalysisModel.py.append(Settings.write_tcl())
    AnalysisModel.py.append("wipe")
    
    
    #textFile = AnalysisModel.py
    
    time_start = time.clock()
    
    AnalysisModel.writeFile(outputFileName)
    
    time_elapsed = (time.clock() - time_start)
    print("Writing Time {}".format(time_elapsed))
    
    
    
    time_start = time.clock()
    
    executable = os.path.join(ghcompfolder,'Alpaca4d\OpenSees-Solvers\opensees.bat')
    a, log = AnalysisModel.runOpensees(executable)
    
    
    time_elapsed = (time.clock() - time_start)
    print("Analyses Time {}".format(time_elapsed))
    
    AlpacaSolvedModel = copy.copy(AnalysisModel)
    AlpacaSolvedModel.isAnalysed = True
# ---------- end ra ----------
gradientlibrary = GradientLibrary(gradIndex=Slider(1, range=1..12))  # -> colors; inputs gradIndex: Int32
#   port colors: A series of colors to be plugged into the "Ladybug_Legend Parameters" component.
# ---------- gradientlibrary: Python ----------
"""
Preset of gradient colors perfect for Data Visualisation
    Inputs:
        gradIndex: An index refering to one of the following possible gradients:
            0 - Orignal Ladybug
            1 - Nuanced Ladybug
            2 - Multi-colored Ladybug
            3 - Ecotect
            4 - Thermal Comfort Percentage
            5 - Thermal Comfort Colors
            6 - Shade Benefit/Harm
            7 - Shade Harm
            8 - Shade Benefit
            9 - CFD Colors 1
            10 - Radiation Benefit
            11 - Gsa10 Colour
            12 - Gsa9 Colour
    Returns:
        customColors: A series of colors.
"""

ghenv.Component.Name = "Gradient Library"
ghenv.Component.NickName = 'GradientLibrary'
#ghenv.Component.Message = 'GradientLibrary\nWIP'

import scriptcontext as sc
import Grasshopper.Kernel as gh
import System

gradientLibrary = {
        0: [System.Drawing.Color.FromArgb(75, 107, 169), System.Drawing.Color.FromArgb(115, 147, 202), System.Drawing.Color.FromArgb(170, 200, 247), System.Drawing.Color.FromArgb(193, 213, 208), System.Drawing.Color.FromArgb(245, 239, 103), System.Drawing.Color.FromArgb(252, 230, 74), System.Drawing.Color.FromArgb(239, 156, 21), System.Drawing.Color.FromArgb(234, 123, 0), System.Drawing.Color.FromArgb(234, 74, 0), System.Drawing.Color.FromArgb(234, 38, 0)],
        1: [System.Drawing.Color.FromArgb(49,54,149), System.Drawing.Color.FromArgb(69,117,180), System.Drawing.Color.FromArgb(116,173,209), System.Drawing.Color.FromArgb(171,217,233), System.Drawing.Color.FromArgb(224,243,248), System.Drawing.Color.FromArgb(255,255,191), System.Drawing.Color.FromArgb(254,224,144), System.Drawing.Color.FromArgb(253,174,97), System.Drawing.Color.FromArgb(244,109,67), System.Drawing.Color.FromArgb(215,48,39), System.Drawing.Color.FromArgb(165,0,38)],
        2: [System.Drawing.Color.FromArgb(4,25,145), System.Drawing.Color.FromArgb(7,48,224), System.Drawing.Color.FromArgb(7,88,255), System.Drawing.Color.FromArgb(1,232,255), System.Drawing.Color.FromArgb(97,246,156), System.Drawing.Color.FromArgb(166,249,86), System.Drawing.Color.FromArgb(254,244,1), System.Drawing.Color.FromArgb(255,121,0), System.Drawing.Color.FromArgb(239,39,0), System.Drawing.Color.FromArgb(138,17,0)],
        3: [System.Drawing.Color.FromArgb(0,0,255), System.Drawing.Color.FromArgb(53,0,202), System.Drawing.Color.FromArgb(107,0,148), System.Drawing.Color.FromArgb(160,0,95), System.Drawing.Color.FromArgb(214,0,41), System.Drawing.Color.FromArgb(255,12,0), System.Drawing.Color.FromArgb(255,66,0), System.Drawing.Color.FromArgb(255,119,0), System.Drawing.Color.FromArgb(255,173,0), System.Drawing.Color.FromArgb(255,226,0), System.Drawing.Color.FromArgb(255,255,0)],
        4: [System.Drawing.Color.FromArgb(0,0,0), System.Drawing.Color.FromArgb(110,0,153), System.Drawing.Color.FromArgb(255,0,0), System.Drawing.Color.FromArgb(255,255,102), System.Drawing.Color.FromArgb(255,255,255)],
        5: [System.Drawing.Color.FromArgb(0,136,255), System.Drawing.Color.FromArgb(200,225,255), System.Drawing.Color.FromArgb(255,255,255), System.Drawing.Color.FromArgb(255,230,230), System.Drawing.Color.FromArgb(255,0,0)],
        6: [System.Drawing.Color.FromArgb(5,48,97), System.Drawing.Color.FromArgb(33,102,172), System.Drawing.Color.FromArgb(67,147,195), System.Drawing.Color.FromArgb(146,197,222), System.Drawing.Color.FromArgb(209,229,240), System.Drawing.Color.FromArgb(255,255,255), System.Drawing.Color.FromArgb(253,219,199), System.Drawing.Color.FromArgb(244,165,130), System.Drawing.Color.FromArgb(214,96,77), System.Drawing.Color.FromArgb(178,24,43), System.Drawing.Color.FromArgb(103,0,31)],
        7: [System.Drawing.Color.FromArgb(255,255,255), System.Drawing.Color.FromArgb(253,219,199), System.Drawing.Color.FromArgb(244,165,130), System.Drawing.Color.FromArgb(214,96,77), System.Drawing.Color.FromArgb(178,24,43), System.Drawing.Color.FromArgb(103,0,31)],
        8: [System.Drawing.Color.FromArgb(255,255,255), System.Drawing.Color.FromArgb(209,229,240), System.Drawing.Color.FromArgb(146,197,222), System.Drawing.Color.FromArgb(67,147,195), System.Drawing.Color.FromArgb(33,102,172), System.Drawing.Color.FromArgb(5,48,97)],
        9: [System.Drawing.Color.FromArgb(0,16,120), System.Drawing.Color.FromArgb(38,70,160), System.Drawing.Color.FromArgb(5,180,222), System.Drawing.Color.FromArgb(16,180,109), System.Drawing.Color.FromArgb(59,183,35), System.Drawing.Color.FromArgb(143,209,19), System.Drawing.Color.FromArgb(228,215,29), System.Drawing.Color.FromArgb(246,147,17), System.Drawing.Color.FromArgb(243,74,0), System.Drawing.Color.FromArgb(255,0,0)],
        10: [System.Drawing.Color.FromArgb(0,191,48), System.Drawing.Color.FromArgb(255,238,184), System.Drawing.Color.FromArgb(255,0,0)],
        11: [System.Drawing.Color.FromArgb(204,0,71), System.Drawing.Color.FromArgb(255,182,71), System.Drawing.Color.FromArgb(206,255,115), System.Drawing.Color.FromArgb(26,180, 214),System.Drawing.Color.FromArgb(0,0,207)],
        12: [System.Drawing.Color.FromArgb(255, 51, 51), System.Drawing.Color.FromArgb(255, 170, 51), System.Drawing.Color.FromArgb(255, 255, 51), System.Drawing.Color.FromArgb(170, 255, 125), System.Drawing.Color.FromArgb(51, 255, 231), System.Drawing.Color.FromArgb(51, 170, 255), System.Drawing.Color.FromArgb(51,51, 255)]}
colors = gradientLibrary[gradIndex]
# ---------- end gradientlibrary ----------
num = Number("25e-0")
dm = DeformedModelAlpaca4d(
    AlpacaSolvedModel=ra.AlpacaSolvedModel,
    step=Slider(0, range=0..10),
    scale=num,
    extrudeModel=Toggle(True),
    typeColor=Slider(2, range=-4..10),
    listColor=gradientlibrary)  # -> DefModel, bounds; inputs step: Int32, extrudeModel: Boolean, typeColor: Int32, listColor: list of Color
# ---------- dm: Python ----------
"""View Deformed model
    Args:
        AlpacaSolvedModel: Output of Analyses solver
        step:
        scale: Multiplication factor for displacement
        extrudeModel:  
True : view extruded model
else : view stick model
        typeColor:  View relative color of the traslation
<=0 : view traslation X 
1 : view traslation Y
2 : view traslation Z
>= 3 : view resulting displacement.
        listColor : one list of color 

    Output:
       DefModel: view deformed model
       bounds: max end min of displacement of the structure 
"""

ghenv.Component.Name = "Deformed Model (Alpaca4d)"
ghenv.Component.NickName = 'DM'
ghenv.Component.Message = "Deformed Model (Alpaca4d)"

from ghpythonlib.componentbase import executingcomponent as component
import System
import rhinoscriptsyntax as rs

import sys
import os
import clr
import clrtype
import Rhino.Geometry as rg
import Rhino as rc
import math as mt
import Grasshopper as gh
import ghpythonlib.treehelpers as th
from ghpythonlib.components import ConstructDomain

ghcompfolder = gh.Folders.DefaultAssemblyFolder
if ghcompfolder not in sys.path:
    sys.path.append(ghcompfolder)
try:
    from Alpaca4d import alpaca4dView as alpacaView
except:
    msg = "Cannot import Alpaca4d. Is the Alpaca4d folder available in " + ghcompfolder + "?"
    ghenv.Component.AddRuntimeMessage(gh.Kernel.GH_RuntimeMessageLevel.Error, msg)
    
FolderPath = rs.DocumentPath()
os.chdir(FolderPath)

ghcompfolder = gh.Folders.DefaultAssemblyFolder
my_module_name = "Alpaca_StepReader" # replace this with something unique that doesn't collide with a real module!
my_module = sys.modules.setdefault(my_module_name, type(sys)(my_module_name))

hdfFilePath = os.path.join(ghcompfolder, "Alpaca4d\HDF5CSharp.dll")
clr.AddReferenceToFileAndPath(hdfFilePath)


from HDF5CSharp import Hdf5

class MyComponent(component):
    
    def RunScript(self, AlpacaSolvedModel, step = None, scale = None , extrudeModel = None, typeColor = None, listColor = [] ):
        import sys
        
        self.extrudeModel = extrudeModel
        
        self.defModel1 = []
        self.defModel2 = []
        self.defModel3 = []
        
        self.beamColor = []
        

        if step == None:
            step = 0
        if scale == None:
            scale = 1
        if extrudeModel == None:
            extrudeModel = False
        if typeColor == None:
            typeColor = 3
        
        if not listColor: listColor = [ System.Drawing.Color.DarkViolet, 
                                        System.Drawing.Color.BlueViolet, 
                                        System.Drawing.Color.RoyalBlue, 
                                        System.Drawing.Color.CornflowerBlue,
                                        System.Drawing.Color.LightSkyBlue, 
                                        System.Drawing.Color.LightBlue,
                                        System.Drawing.Color.CadetBlue,
                                        System.Drawing.Color.LightGreen,
                                        System.Drawing.Color.GreenYellow,
                                        System.Drawing.Color.Yellow,
                                        System.Drawing.Color.Orange,
                                        System.Drawing.Color.Red,
                                        System.Drawing.Color.DarkRed]
        
        
        ghcompfolder = gh.Folders.DefaultAssemblyFolder
        if ghcompfolder not in sys.path:
            sys.path.append(ghcompfolder)
    
        try:
            Steps = my_module.Steps
        except AttributeError:
            type_2d = type(System.Array.CreateInstance(float, 1, 1))
                
            class Steps(object):
                __metaclass__ = clrtype.ClrClass
                _clrfields = {"STEP_{}".format(i): type_2d for i in range(1000)} # it will work for model with less than 1000 steps
                
            my_module.Steps = Steps
            
        checkData = True
        
        if not AlpacaSolvedModel:
            checkData = False
            msg = "Input parameter AlpacaSolvedModel failed to collect data"
            ghenv.Component.AddRuntimeMessage(gh.Kernel.GH_RuntimeMessageLevel.Warning, msg)
        else:
            try:
                fileId = Hdf5.OpenFile(AlpacaSolvedModel.recorderName, True)
                numberOfPoints = len(AlpacaSolvedModel.uniquePoints) #
                        
                        
                displacementResult = Hdf5.ReadObject[Steps](fileId, "/MODEL_STAGE[1]/RESULTS/ON_NODES/DISPLACEMENT/DATA")
                displacement = []
                rotation = []
                dispNodeList = []
                for i in range(numberOfPoints):
                    tag = i + 1
                    vx = getattr(displacementResult, 'STEP_{}'.format(step))[i,0]
                    vy = getattr(displacementResult, 'STEP_{}'.format(step))[i,1]
                    vz = getattr(displacementResult, 'STEP_{}'.format(step))[i,2]
                    trasl = rg.Vector3d(vx,vy,vz)
                    displacement.append(trasl)
                    dispNodeList.append( [tag, trasl] )
                    
                Hdf5.CloseFile(fileId)
                print("I have closed the file")
            
                dispNodeDict = dict( dispNodeList )
                #---------------------------------------------------#
                defEleVector1 = alpacaView.BeamVectorDef(AlpacaSolvedModel,dispNodeDict) #beam
                defEleVector2 = alpacaView.ShellVectorDef(AlpacaSolvedModel,dispNodeDict) #shell
                defEleVector3 = alpacaView.BrickVectorDef(AlpacaSolvedModel,dispNodeDict) #shell
                bound = alpacaView.boundsDef(displacement, typeColor)
                if self.extrudeModel == None or self.extrudeModel == False:
                    #BEAM
                    defModel1 = alpacaView.BeamDef(AlpacaSolvedModel, dispNodeDict,scale)
                    self.defModel1, self.beamColor = alpacaView.ColorBeamDef( defModel1, defEleVector1, bound, listColor, typeColor)
                    #SHELL
                    defModel2 = alpacaView.ShellDef(AlpacaSolvedModel,dispNodeDict,scale)
                    #BRICK
                    defModel3 = alpacaView.BrickDef(AlpacaSolvedModel,dispNodeDict,scale)
                else:
                    #BEAM
                    defModel1 = alpacaView.BeamDefExtrude(AlpacaSolvedModel, dispNodeDict,scale)
                    self.defModel1 = alpacaView.ColorBeamDefExtrude( defModel1, defEleVector1, bound, listColor, typeColor)
                    #SHELL
                    defModel2 = alpacaView.ShellDefExtrude(AlpacaSolvedModel,dispNodeDict,scale)
                    #BRICK
                    defModel3 = alpacaView.BrickDef(AlpacaSolvedModel,dispNodeDict,scale)
                    
                #SHELL COLOR
                self.defModel2 = alpacaView.ColorShellDef( defModel2, defEleVector2 , bound, listColor, typeColor, extrudeModel )
                #BRICK COLOR
                self.defModel3 = alpacaView.ColorBrickDef( defModel3, defEleVector3 , bound, listColor, typeColor)
                DefModel = th.list_to_tree(self.defModel1 + defModel2 + defModel3)
                bounds = ConstructDomain(bound[0], bound[1])
                return (DefModel, bounds)
            except:
                Hdf5.CloseFile(fileId)
                print("I have closed the file due to exception")
            # return outputs if you have them; here I try it for you:
        
        
    def DrawViewportWires(self,arg):
        for iMesh in self.defModel2 :
            colorWirframe = System.Drawing.Color.Black
            arg.Display.DrawMeshWires(iMesh, colorWirframe)
            
        for iMesh in self.defModel3 :
            colorWirframe = System.Drawing.Color.Black
            arg.Display.DrawMeshWires(iMesh, colorWirframe)
        if self.extrudeModel is None or self.extrudeModel is False:
            thickness =2
            for iBeam, iColor in zip(self.defModel1, self.beamColor) :
                for jBeam, jColor in zip(iBeam, iColor):
                    arg.Display.DrawCurve(jBeam, jColor, thickness)
        else:
            for iBeam in self.defModel1 :
                colorWirframe = System.Drawing.Color.Black
                arg.Display.DrawMeshWires(iBeam, colorWirframe)
# ---------- end dm ----------
abs = Absolute(Value=dm.bounds)
dedomain = DeconstructDomain(Domain=abs)  # -> Start, End
max = Maximum(A=dedomain.Start, B=dedomain.End)
panel_4 = Panel(max)
data_8 = Data(panel_4)
rec = DataRecorder(data_8, DataLimit=-10, RecordData=True)
graph = QuickGraph(rec, SortOrder=0)

# ---- group: Fondazione
nv_3 = NakedVertices(Mesh=item_2)  # -> ClothedIndex, NakedIndex, ClothedPts, NakedPts; disabled
data_9 = Data(nv_3.NakedPts)  # disabled
fcircle_2 = CircleFit(Points=data_9)  # -> Circle, Radius, Deviation; disabled
alongcrv_2 = SortAlongCurve(Points=data_9, Curve=fcircle_2.Circle)  # -> Points, Indices; disabled
toggle_3 = BooleanToggle(True)  # disabled
pline_3 = PolyLine(Vertices=alongcrv_2.Points, Closed=toggle_3)  # -> reparameterize(Polyline); disabled
explode_4 = Explode(Curve=pline_3, Recursive=True)  # -> Segments, Vertices; disabled
area_3 = Area(Geometry=pline_3)  # -> Area, Centroid; disabled
len = Length(Curve=explode_4.Segments)  # disabled
panel_5 = Panel("1")  # disabled
panel_6 = Panel("1.2")  # disabled
panel_7 = Panel("1")  # disabled
ma = MassAddition(Input=len)  # -> Result, PartialResults; disabled
dom_2 = ConstructDomain(DomainStart=panel_5, DomainEnd=panel_6)  # disabled
range_2 = Range(Domain=dom_2, Steps=panel_7)  # disabled
toggle_4 = BooleanToggle(False)  # disabled
eval = EvaluateLength(Curve=pline_3, Length=ma.PartialResults, Normalized=toggle_4)  # -> Point, Tangent, Parameter; disabled
panel_8 = Panel("0")  # disabled
scale = Scale(Geometry=pline_3, Center=area_3.Centroid, Factor=range_2)  # -> Geometry, Transform; disabled
ins = InsertItems(List=eval.Parameter, Item=panel_8, Indices=panel_8, Wrap=True)  # disabled
shatter = Shatter(Curve=reparameterize(scale.Geometry), Parameters=ins)  # disabled
number_slider_4 = Slider(1, range=0..10)  # disabled
number_slider_5 = Slider(2, range=0..10)  # disabled
flip_2 = FlipMatrix(Data=shatter)  # disabled
number_slider_6 = Slider(1, range=0..100)  # disabled
panel_9 = Panel("1")  # disabled
loft = Loft(Curves=flip_2, Options={Adjust=False, Closed=False, LoftEnds=0, LoftSimp=0, LoftType=0, Rebuild=10, Refit=0.01})  # disabled
series_2 = Series(Start=0, Step=number_slider_4, Count=number_slider_5)  # disabled
mjoin = MeshJoin(Meshes=item_2)  # disabled
mesh_uv_2 = MeshSurface(Surface=loft, UCount=number_slider_6, VCount=panel_9, Overhang=True, Equalize=False)  # -> flatten(Mesh); disabled
Z_2 = UnitZ(Factor=series_2)  # disabled
clean = CombineClean(Meshes=mjoin)  # disabled
neg = Negative(Value=Z_2)  # disabled
mjoin_2 = MeshJoin(Meshes=flatten([clean, mesh_uv_2]))  # disabled

# ----
clean_2 = CombineClean(Meshes=mjoin_2)  # disabled

# ---- group: Fondazione (continued)
move_2 = Move(Geometry=clean_2, Motion=neg)  # -> Geometry, Transform; disabled

# ----
item_4 = ListItem(List=move_2.Geometry, Index=0, Wrap=True)  # -> Item, Item1; disabled

# ---- group: Fondazione
mstb_3 = MeshSeriesToBrickAlpaca4d(MeshSeries=move_2.Geometry)  # -> simplify(flatten(Brick)); inputs MeshSeries: list of Mesh; same code as mstb

# ----
ssp_2 = SSPBrickAlpaca4d(Brick=mstb_3, nDMaterial=python.nDMaterial, Colour=ColourSwatch(SwatchColor=RGB(161, 161, 161)))  # -> out, Element; inputs Brick: Mesh, Colour: Color; same code as ssp

# ==== cluster Cluster
M = ClusterInput()
N = ClusterInput()
B = ClusterInput()
nv = NakedVertices(Mesh=M)  # -> ClothedIndex, NakedIndex, ClothedPts, NakedPts
data = Data(nv.NakedPts)
fcircle = CircleFit(Points=data)  # -> Circle, Radius, Deviation
alongcrv = SortAlongCurve(Points=data, Curve=fcircle.Circle)  # -> Points, Indices
pline = PolyLine(Vertices=alongcrv.Points, Closed=Toggle(True))  # -> reparameterize(Polyline)
explode = Explode(Curve=pline, Recursive=True)  # -> Segments, Vertices
area = Area(Geometry=pline)  # -> Area, Centroid
len = Length(Curve=explode.Segments)
ma = MassAddition(Input=len)  # -> Result, PartialResults
dom = ConstructDomain(DomainStart="1", DomainEnd=B)
range = Range(Domain=dom, Steps=N)
eval = EvaluateLength(Curve=pline, Length=ma.PartialResults, Normalized=Toggle(False))  # -> Point, Tangent, Parameter
scale = Scale(Geometry=pline, Center=area.Centroid, Factor=range)  # -> Geometry, Transform
ins = InsertItems(List=eval.Parameter, Item="0", Indices="0", Wrap=True)
N_2 = ClusterInput()
C = ClusterInput()
shatter = Shatter(Curve=reparameterize(scale.Geometry), Parameters=ins)
flip = FlipMatrix(Data=shatter)
loft = Loft(Curves=flip, Options={Adjust=False, Closed=False, LoftEnds=0, LoftSimp=0, LoftType=0, Rebuild=10, Refit=0.01})
series = Series(Start=0, Step=N_2, Count=C)
mesh_uv = MeshSurface(Surface=loft, UCount=Slider(5, range=0..100), VCount="1", Overhang=True, Equalize=False)  # -> flatten(Mesh)
Z = UnitZ(Factor=series)
neg = Negative(Value=Z)
mjoin = MeshJoin(Meshes=flatten([mesh_uv, M]))
clean = CombineClean(Meshes=mjoin)
move = Move(Geometry=clean, Motion=neg)  # -> Geometry, Transform
G = ClusterOutput(move.Geometry)

# ==== cluster Cluster_2
T = ClusterInput()
i = ClusterInput()
graft = GraftTree(Tree=T, IncludeEmptyLists=True, IncludeNullItems=True)
nv = NakedVertices(Mesh=graft)  # -> ClothedIndex, NakedIndex, ClothedPts, NakedPts
data = Data(nv.NakedPts)
fcircle = CircleFit(Points=data)  # -> Circle, Radius, Deviation
alongcrv = SortAlongCurve(Points=data, Curve=fcircle.Circle)  # -> Points, Indices
pline = PolyLine(Vertices=alongcrv.Points, Closed=Toggle(False))
explode = Explode(Curve=pline, Recursive=True)  # -> Segments, Vertices
item = ListItem(List=explode.Vertices, Index=i, Wrap=True)  # -> flatten(Item), flatten(Item1)
cull_i = CullIndex(List=item.Item, Indices="-1", Wrap=True)
cull_i_2 = CullIndex(List=item.Item1, Indices="-1", Wrap=True)
cull_i_3 = CullIndex(List=item.Item1, Indices="0", Wrap=True)
cull_i_4 = CullIndex(List=item.Item, Indices="0", Wrap=True)
ln = Line(StartPoint=cull_i, EndPoint=cull_i_3)
ln_2 = Line(StartPoint=cull_i_2, EndPoint=cull_i_4)
entwine = Entwine(Branch00=ln, Branch01=ln_2, FlattenInputs=True)
R = ClusterOutput(entwine)
