# Grasshopper definition StairCase_test.gh (Grasshopper 1.0.7)
# plug-ins: MeshEdit Components, Kangaroo Components, ggRhinoIFC

gggrasshoppersettings = GgGrasshopperSettings(
    SettingsData_IFCSettings_Format="STEP",
    SettingsData_IFCSettings_GenerateOwnerHistory=True,
    SettingsData_IFCSettings_IdentifyObsolete=True,
    SettingsData_IFCSettings_LastUsedUnits="Meters",
    SettingsData_IFCSettings_Radians=True,
    SettingsData_IFCSettings_RepMapExport="NONE",
    SettingsData_IFCSettings_Target="Universal",
    SettingsData_IFCSettings_VersionIFC="IFC2x3",
    SettingsData_RevitSettings_Format="STEP",
    SettingsData_RevitSettings_GenerateOwnerHistory=True,
    SettingsData_RevitSettings_IdentifyObsolete=True,
    SettingsData_RevitSettings_LastUsedUnits="Meters",
    SettingsData_RevitSettings_Radians=True,
    SettingsData_RevitSettings_RepMapExport="NONE",
    SettingsData_RevitSettings_Target="Universal",
    SettingsData_RevitSettings_VersionIFC="IFC4")
crv = Curve([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])

# ----
# nDMaterial_ElasticOrthotropic
panel = Panel("21000")  # disabled
panel_2 = Panel("0.3")  # disabled
panel_3 = Panel("8070")  # disabled
panel_4 = Panel("10")  # disabled
panel_5 = Panel("0.3")  # disabled
panel_6 = Panel("21000")  # disabled
panel_7 = Panel("8070")  # disabled
panel_8 = Panel("500")  # disabled
ghpython_script = GhPythonScript(Ex=panel, Ey=panel, Ez=panel, vxy=panel_2, vyz=panel_2, vzx=panel_2, Gxy=panel_3, Gyz=panel_3, Gzy=panel_3, rho=panel_4)  # -> out, nDMaterial; disabled
# ---------- ghpython_script: Python ----------
import opensees.openseesGH as alpaca


nDMaterial = alpaca.ElasticOrthotropic(name, Ex,Ey,Ez,vxy,vyz,vzx,Gxy,Gyz,Gzy,rho,fy)




print(nDMaterial.write_tcl())
# ---------- end ghpython_script ----------
ghpython_script_2 = GhPythonScript(
    Ex=panel_6,
    Ey=panel_6,
    Ez=panel_6,
    vxy=panel_5,
    vyz=panel_5,
    vzx=panel_5,
    Gxy=panel_7,
    Gyz=panel_7,
    Gzy=panel_7,
    rho=panel_8)  # -> out, nDMaterial; disabled
# ---------- ghpython_script_2: Python ----------
import opensees.openseesGH as alpaca


nDMaterial = alpaca.ElasticOrthotropic(name, Ex,Ey,Ez,vxy,vyz,vzx,Gxy,Gyz,Gzy,rho,fy)

print(nDMaterial.rho)
print(nDMaterial.vxy)

print(nDMaterial.write_tcl())
# ---------- end ghpython_script_2 ----------
merge = Merge(Data1=ghpython_script.nDMaterial, Data2=ghpython_script_2.nDMaterial, Data3=ghpython_script.nDMaterial)  # disabled
panel_9 = Panel("""10
10
10""")  # disabled
panel_10 = Panel("CLT")  # disabled
python = GhPythonScript(sectionName=panel_10, materials=merge, thicknesses=panel_9)  # -> out, layeredShellSection; inputs materials: list, thicknesses: list; disabled
# ---------- python: Python ----------
import opensees.openseesGH as alpaca

#layeredShellSection = alpaca.LayeredShell(sectionName, materials, thicknesses)
#layeredShellSectionPY = alpaca.LayeredShell(sectionName, materials, thicknesses).write_py()

layeredShellSection = alpaca.LayeredShell(sectionName, materials, thicknesses)
# ---------- end python ----------

# ----
# nDMaterial_ElasticIsotropic
panel_11 = Panel("S235")
ghpython_script_3 = GhPythonScript(name=panel_11, E="21000", G="8070", v="0.3", rho="10")  # -> out, nDMaterial
# ---------- ghpython_script_3: Python ----------
import opensees.openseesGH as alpaca


nDMaterial = alpaca.ElasticIsotropic(name, E, G, rho, v)

print(nDMaterial.rho)
print(nDMaterial.v)

print(nDMaterial.write_tcl())
# ---------- end ghpython_script_3 ----------
mesh = Mesh([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])

ghpython_script_4 = GhPythonScript(thickness="5", nDMaterial=ghpython_script_3.nDMaterial)  # -> out, fiberSection
# ---------- ghpython_script_4: Python ----------
import opensees.openseesGH as alpaca

fiberSection = alpaca.PlateFiberSection(sectionName, thickness, nDMaterial)

print(fiberSection.write_tcl())
# ---------- end ghpython_script_4 ----------

clean = CombineClean(Meshes=mesh)
mesh_explode = MeshExplode(Mesh=clean, Interpolate=False)  # -> flatten(Faces)
ghpython_script_5 = GhPythonScript(Mesh=mesh_explode, CrossSection=ghpython_script_4.fiberSection, Color=ColourSwatch(SwatchColor=RGB(255, 255, 255)))  # -> out, Shell, Vertices; inputs Mesh: Mesh, Color: Color
# ---------- ghpython_script_5: Python ----------
import opensees.openseesGH as alpaca
import copy

Shell = alpaca.ShellMITC4(Mesh, copy.deepcopy(CrossSection), Color)



Vertices = Shell.Mesh.Vertices.ToPoint3dArray()
# ---------- end ghpython_script_5 ----------
panel_12 = Panel("""0.0
1.0
0.0
0
0
0
0
0
0
0
0.0
0.0
0.0
0
0
0
0
0
0
0""")
dom = ConstructDomain(DomainStart=Slider(0, range=0..20), DomainEnd=Slider(5, range=0..20))
dom_2 = ConstructDomain(DomainStart=Slider(0, range=0..20), DomainEnd=Slider(5, range=0..20))
range = Range(Domain=dom_2, Steps="20")
range_2 = Range(Domain=dom, Steps="20")
pi = Pi(Factor=Slider(2, range=0..2))
number_slider = Slider(1, range=1..21)
python_2 = GhPythonScript(x=range_2)  # -> out, values
# ---------- python_2: Python ----------
import random

values = random.uniform(-1, 1)
# ---------- end python_2 ----------
python_3 = GhPythonScript(x=range)  # -> out, values
# ---------- python_3: Python ----------
import random

values = random.uniform(-10, 10)
# ---------- end python_3 ----------
eval = Evaluate(F="x^2", x=range_2)
eval_2 = Evaluate(F="x^2", x=range)
eval_3 = Evaluate(F="sin(x)^2*(x-10)", x=range_2)
eval_4 = Evaluate(F="sin(x)^2*(x-10)", x=range)
panel_13 = Panel("0.50 to 2.00")
lng = ListLength(List=panel_12)
random = Random(Range="0.50 to 2.00", Number="2", Seed=2)
entwine = Entwine(Branch00=eval, Branch01=python_2.values, Branch02=eval_3, FlattenInputs=True)
entwine_2 = Entwine(Branch00=eval_2, Branch01=python_3.values, Branch02=eval_4, FlattenInputs=True)
number_slider_2 = Slider(0, range=0..4)
num = Number(random)
range_3 = Range(Domain=Domain(0, 1), Steps=10)
ghpython_script_6 = GhPythonScript(ConstantFactor="5")  # -> timeSeries, Graph
# ---------- ghpython_script_6: Python ----------
class TimeSeriesConstant(object):
    def __init__(self, cFactor):
        self.seriesType = "Constant"
        self.cFactor = cFactor
        
        self.timeSeriesTag = None

    def ToString(self):
        return self.write_tcl()

    def write_tcl(self):
        return "timeSeries Constant {} -factor {}".format(self.timeSeriesTag, self.cFactor)

    def write_py(self):
        return "ops.timeSeries('Constant',{},'-factor', {})".format(self.timeSeriesTag, self.cFactor)

timeSeries = TimeSeriesConstant(ConstantFactor)

def ConstantSeries(x):
    return x

Graph = []

for x in range(10):
    Graph.append(ConstantSeries(2))
# ---------- end ghpython_script_6 ----------
ghpython_script_7 = GhPythonScript(linearFactor=num)  # -> timeSeries, Graph
# ---------- ghpython_script_7: Python ----------
class TimeSeriesLinear(object):
    def __init__(self, linearFactor):
        self.seriesType = "linear"
        self.linearFactor = linearFactor
        
        self.timeSeriesTag = None

    def ToString(self):
        return self.write_tcl()

    def write_tcl(self):
        return "timeSeries Linear {} -factor {}".format(self.timeSeriesTag, self.linearFactor)

    def write_py(self):
        return "ops.timeSeries('Linear',{},'-factor', {})".format(self.timeSeriesTag, self.linearFactor)

timeSeries = TimeSeriesLinear(linearFactor)

a = 1
def linearSeries(x):
    return x

Graph = []

for x in range(10):
    Graph.append(linearSeries(x * linearFactor))
# ---------- end ghpython_script_7 ----------
python_4 = GhPythonScript(time=range_2, values=entwine, factor="1")  # -> out, timeSeries, Graph; inputs time: list, values: list
# ---------- python_4: Python ----------
class TimeSeriesPath(object):
    def __init__(self, values, time, factor):
        self.seriesType = "path"
        self.values = values
        self.time = time
        self.factor = factor
        self.timeSeriesTag = None
    
    def ToString(self):
        return self.write_tcl()

    def write_tcl(self):
        time = [str(x) for x in self.time]
        time = ' '.join(time)
        
        values = [str(x) for x in self.values]
        values = ' '.join(values)
        tcl_text = "timeSeries Path %s -time {%s} -values {%s} -factor %s\n" % (self.timeSeriesTag, time, values, self.factor)
        return tcl_text

    def write_py(self):
        py_text = "ops.timeSeries('Path', {}, '-values', *{}, '-time', *{}, '-factor', {})".format(self.timeSeriesTag, self.values, self.time, self.factor)
        return py_text



timeSeries = TimeSeriesPath(values, time, factor)

Graph = values

print(timeSeries.write_tcl())
# ---------- end python_4 ----------
python_5 = GhPythonScript(time=range, values=entwine_2, factor="1")  # -> out, timeSeries, Graph; inputs time: list, values: list
# ---------- python_5: Python ----------
import opensees.openseesGH as alpaca


timeSeries = alpaca.TimeSeriesPath(values, time, factor)

Graph = values
# ---------- end python_5 ----------
addition = Addition(A=Slider(1, range=0..10), B=range_3)
panel_14 = Panel(python_4.timeSeries)
bang = ExplodeTree(Data=python_4.timeSeries)  # -> Branch0, Branch1, Branch2
ghpython_script_8 = GhPythonScript(tStart=range_3, tEnd=addition, period=Slider(2, range=1..10), Factor="5", shift=Slider(0, range=0..10))  # -> timeSeries, Graph
# ---------- ghpython_script_8: Python ----------
import opensees.openseesGH as alpaca
import math

timeSeries = alpaca.TimeSeriesTrigonometric(tStart, tEnd, period, Factor, shift)

print(math.sin(shift))
def TrigonometricSeries(tStart, tEnd, period, shift, Factor,t):
    if tStart <= t and t < tEnd:
        x = Factor * math.sin( (2.0 * math.pi * (t - tStart))/period + shift)
        return x
    else:
        return 0

def linspace(a, b, n):
    if n < 2:
        return None
    diff = (float(b) - a)/(n - 1)
    return [diff * i + a  for i in range(n)]


print(linspace(tStart,tEnd*2,2))

Graph = []

for t in linspace(0,tEnd*2,100):
    Graph.append(TrigonometricSeries(tStart, tEnd, period, shift, Factor,t))
# ---------- end ghpython_script_8 ----------
graph = QuickGraph(python_4.Graph, SortOrder=0)
graph_2 = QuickGraph(ghpython_script_6.Graph, SortOrder=0)
graph_3 = QuickGraph(ghpython_script_7.Graph, SortOrder=0)
graph_4 = QuickGraph(python_5.Graph, SortOrder=0)

# ----
# we should find a user friendly approach for AnalysisType and Test input
# Analysis
# It can be scary to insert all this value.
# Maybe default setting in Analysis type
# and use only numIncr
panel_15 = Panel("NormDispIncr 1.0e-6 12 5")
list = ValueList({"Linear", "Newton", "NewtonLineSearch", "ModifiedNewton", "KrylovNewton", "SecantNewton", "BFGS", "Broyden"}, selected="KrylovNewton")
list_2 = ValueList({"Static", "Transient"}, selected="Transient")
python_6 = GhPythonScript(
    Constraint="Transformation",
    Numberer="RCM",
    System="BandSPD",
    Test=panel_15,
    Algorithm=list,
    Integrator="Newmark 0.5 0.25",
    AnalysisType=list_2,
    AnalysesSteps="2 0.1")  # -> out, a
# ---------- python_6: Python ----------
import opensees.openseesGH as alpaca

# default Value

ConstraintList = ['Plain', 'Transformation']


for item in ConstraintList:
    if Constraint.lower() == item.lower():
        print(item)
        Constraint = item


# default Value

NumbererList = ['RCM', 'AMD', 'Plain', 'ParallelPlain', 'ParallelRCM']

for i,item in enumerate(NumbererList):
    if Numberer.lower() == item.lower():
        Numberer = item



# default Value

SystemList = ['BandGen', 'BandSPD', 'ProfileSPD', 'SuperLU', 'UmfPack', 'FullGeneral', 'SparseSYM']

for i,item in enumerate(SystemList):
    if System.lower() == item.lower():
        System = item


# default Value

AnalysisTypeList = ['Static', 'Transient']

for item in AnalysisTypeList:
    if AnalysisType.lower() == item.lower():
        AnalysisType = item




a = alpaca.Analysis(Constraint, Numberer,System,Test,Algorithm,Integrator,AnalysisType, AnalysesSteps)

print(a.write_tcl())
# ---------- end python_6 ----------

panel_16 = Panel("LoadControl 0.1")

beam = Curve(crv)
# when it is selected, Diagram of Sigma/Epsilon?
panel_17 = Panel("2500")
explode = Explode(Curve=beam, Recursive=True)  # -> Segments, simplify(Vertices)
number_slider_3 = Slider(7, range=1..20)
number_slider_4 = Slider(5, range=1..20)

# ----
# uniAxial
panel_18 = Panel("210")
ghpython_script_9 = GhPythonScript(name="S235", E=panel_18, eta=Slider(9.55, range=5..20), G="80760", v="0.3", rho=panel_17)  # -> out, steel
# ---------- ghpython_script_9: Python ----------
import opensees.openseesGH as alpaca


steel = alpaca.uniAxialMaterialElastic(name, E, Eneg, eta, G, v, rho)


print(steel.Eneg)



print(steel.write_tcl())
# ---------- end ghpython_script_9 ----------

python_7 = GhPythonScript(
    secName="section",
    Area="5000",
    Izz=number_slider_4,
    Iyy=number_slider_3,
    J=Slider(6, range=1..20),
    alphaY=number_slider_4,
    alphaZ=number_slider_3,
    material=ghpython_script_9.steel)  # -> out, a
# ---------- python_7: Python ----------
import opensees.openseesGH as alpaca
import copy

#newMaterial = copy.copy(material)

#a = alpaca.ElasticSection(secName, Area, Izz, Iyy, J, alphaY, alphaZ, newMaterial)

a = alpaca.ElasticSection(secName, Area, Izz, Iyy, J, alphaY, alphaZ, material)
# ---------- end python_7 ----------
ghpython_script_10 = GhPythonScript(Line=explode.Segments, CrossSection=python_7.a, Colour=ColourSwatch(SwatchColor=RGB(255, 255, 255)))  # -> out, element; inputs Line: Curve, Colour: Color, Orient: Boolean
# ---------- ghpython_script_10: Python ----------
import opensees.openseesGH as alpaca
import copy


newCrossSection = copy.deepcopy(CrossSection)

if not Colour:
    Colour = Color.Red

if Orient is None:
    Orient = 0.0

element = alpaca.ForceBeamColumn(Line, newCrossSection, Colour, Orient)
# ---------- end ghpython_script_10 ----------

pt = Point([Point(3.73857522, 4.684167385, 0.1333333403), Point(4.728302002, 3.870160103, 0), Point(8.235173225, 9.790262222, 2.400000095), Point(7.145588875, 10.43569565, 2.400000095)])
boolean_toggle = BooleanToggle(True)
boolean_toggle_2 = BooleanToggle(True)

item = ListItem(List=pt, Index=0, Wrap=True)  # -> Item, Item1, Item2, Item3

ghpython_script_11 = GhPythonScript(
    Pos=[item.Item1, item.Item2, item.Item3, item.Item],
    Tx=boolean_toggle_2,
    Ty=boolean_toggle_2,
    Tz=boolean_toggle_2,
    Rx=boolean_toggle,
    Ry=boolean_toggle,
    Rz=boolean_toggle)  # -> out, Support; inputs Pos: Point3d, Tx: Boolean, Ty: Boolean, Tz: Boolean, Rx: Boolean, Ry: Boolean, Rz: Boolean
# ---------- ghpython_script_11: Python ----------
import opensees.openseesGH as alpaca


Tx = int(False) if Tx is None else int(Tx)
Ty = int(False) if Ty is None else int(Ty)
Tz = int(False) if Tz is None else int(Tz)
Rx = int(False) if Rx is None else int(Rx)
Ry = int(False) if Ry is None else int(Ry)
Rz = int(False) if Rz is None else int(Rz)


Support = alpaca.Support(Pos, Tx, Ty, Tz, Rx, Ry, Rz)
# ---------- end ghpython_script_11 ----------
data = Data(ghpython_script_11.Support)

# ----
# Point Load
pt_2 = Point([Point(4.325274486, 4.3366262, 0.1333333403), Point(4.507751006, 4.644672889, 0.2666666806), Point(4.675107369, 4.927194504, 0.400000006), Point(4.831871638, 5.191834963, 0.5333333611), Point(4.994991192, 5.467204241, 0.6666666865), Point(5.160229096, 5.746149687, 0.8000000119)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])
vector_xyz = VectorXYZ(XComponent=0, YComponent=0, ZComponent="-100")  # -> Vector, Length
vector_xyz_2 = VectorXYZ(XComponent=0, YComponent=0, ZComponent=0)  # -> Vector, Length

lng_2 = ListLength(List=pt_2)
series = Series(Start=0, Step="0.2", Count=lng_2)
addition_2 = Addition(A=series)
series_2 = Series(Start="0", Step="-1", Count=lng_2)
neg = Negative(Value=series_2)
shift = ShiftList(List=panel_12, Shift=series_2, Wrap=True)

dom_3 = ConstructDomain(DomainStart=Slider(0, range=0..20), DomainEnd=Slider(5, range=0..20))
panel_19 = Panel("x^2")
graph_5 = QuickGraph(shift, SortOrder=0)

range_4 = Range(Domain=dom_3, Steps=expr("x-1", "20"))
remap = RemapNumbers(Value=range_4, Source=dom_3, Target=pi)  # -> Mapped, Clipped

eval_5 = Evaluate(F="sin(x*2)", x=remap.Mapped)
python_8 = GhPythonScript(time=range_4, values=shift, factor="1")  # -> out, flatten(timeSeries), Graph; inputs time: list, values: list; same code as python_4
bang_2 = ExplodeTree(Data=python_8.timeSeries)  # -> Branch0, Branch1, Branch2

ghpython_script_12 = GhPythonScript(Pos=pt_2, Force=vector_xyz.Vector, Moment=vector_xyz_2.Vector, TimeSeries=python_8.timeSeries)  # -> out, PointLoad; inputs Pos: Point3d, Force: Vector3d, Moment: Vector3d
# ---------- ghpython_script_12: Python ----------
class PointLoad(object):
    def __init__(self, Pos, Force, Moment, TimeSeries):

        self.Pos = Pos
        self.Force = Force
        self.Moment = Moment

        self.nodeTag = None

        self.type = "PointLoad"

        self.PatternTag = None
        self.TimeSeries = TimeSeries


    def setNodeTag(self, cloudPoint):
        self.nodeTag = cloudPoint.ClosestPoint(self.Pos) + 1
        pass

    @staticmethod
    def getPointLoad(Loads):
        #return a Dictionary PointLoad. Loads is a List

        Load = sorted(Loads, key=lambda load: load.PatternTag)

        pointLoad = defaultdict(list)

        for obj in Load:
            pointLoad[obj.PatternTag].append(obj)
        
        return pointLoad

    #TODO
    # Allowing for more than one time series
    @staticmethod
    def write_py(LoadDict):

        text = []

        for patternTag in LoadDict.keys():
            text.append("ops.pattern('Plain',{},1)".format(patternTag))
            for load in LoadDict[patternTag]:
                text.append("ops.load(%s, %s, %s, %s, %s, %s, %s)" % (load.nodeTag, load.Force.X, load.Force.Y, load.Force.Z, load.Moment.X, load.Moment.Y, load.Moment.Z))

        text = "\n".join(text)

        return text

    def ToString(self):
        return "<Class PointLoad>"

PointLoad = PointLoad(Pos, Force, Moment, TimeSeries)
# ---------- end ghpython_script_12 ----------

data_2 = Data(flatten(ghpython_script_12.PointLoad))
# tcl
ghpython_script_13 = GhPythonScript(Element=flatten([ghpython_script_5.Shell, ghpython_script_10.element]), Support=flatten(data), Load=flatten(data_2))  # -> out, model, uniquePoint; inputs Element: list, Support: list, Load: list, Constraint: list
# ---------- ghpython_script_13: Python ----------
import os
import opensees.openseesGH as alpaca
import ghpythonlib.treehelpers as th
import Rhino.Geometry as rg
import rhinoscriptsyntax as rs
from collections import defaultdict, OrderedDict
import copy
import time



FolderPath = rs.DocumentPath()
os.chdir(FolderPath)

# create the object model
model = alpaca.Model()


start = time.clock()
#subdivide element per type

for element in Element:
    if element.type == "Beam":
        model.beams.append(element)
    elif element.type == "Shell":
        model.shells.append(element)
    elif element.type == "Brick":
        model.bricks.append(element)

end = time.clock() - start

print("time to subdivide element {}".format(end))

# create a list of unique point
# need to add the rigid constraint

model.getuniquePoints(model.beams, model.shells, model.bricks)


end = time.clock() - end

print("time to get uniquepoints {}".format(end))

#############
# create node and assign to object
#############

if model.uniquePointsThreeNDF:
    model.py.append(alpaca.Model.write3nd_tcl())
    for point in model.uniquePointsThreeNDF:
        node = alpaca.Node(point)
        node.ndf = 3
        node.setNodeTag(model.cloudPoint)
        model.nodes.append( node )
    
        model.py.append(node.write_tcl())

if model.uniquePointsSixNDF:
    model.py.append(alpaca.Model.write6ndf_tcl())
    for point in model.uniquePointsSixNDF:
        node = alpaca.Node(point)
        node.ndf = 6
        node.setNodeTag(model.cloudPoint)
        model.nodes.append( node )
     
        model.py.append(node.write_tcl())



#a = model.sixNDFModel
#b = model.threeNDFModel

#################
# create supports
#################

for supportNode in Support:
    if model.uniquePointsThreeNDF.Contains(supportNode.Pos):
        supportNode.ndf = 3
        model.threeNDFModel.append(supportNode)
    elif model.uniquePointsSixNDF.Contains(supportNode.Pos):
        supportNode.ndf = 6
        model.sixNDFModel.append(supportNode)
    else:
        raise ValueError('I can not find the node at location {0}'.format(supportNode.Pos.ToString()))
    
    supportNode.setNodeTag(model.cloudPoint)
    model.supports.append(supportNode)
    model.py.append(supportNode.write_tcl())



####################
# create constraints
####################


for constraint in Constraint:
    constraint.setNodeTag(model.cloudPoint)
    model.constraints.append(constraint)


# write py file


# assign tag and node Index to element and shell
for index, element in enumerate(Element,1):
    element.setTopology(model.cloudPoint)
    element.eleTag = index
    # assign the same eleTag at the rest
    element.setTags()


## load

for item in Load:
    item.setNodeTag(model.cloudPoint)

for item in model.beams:
    model.py.append(item.write_tcl())

for item in model.shells:
    model.py.append(item.write_tcl())


for item in Constraint:
    model.py.append(item.write_tcl())


timeSeriesDict = alpaca.TimeSeries.getTimeSeries(Load)[1]

model.py.append(alpaca.PointLoad.write_tcl(timeSeriesDict))

model.py.append(alpaca.TCLRecorder.mpco("recorder.mpco", True,True,True,True,False,False))
# ---------- end ghpython_script_13 ----------
data_3 = Data(ghpython_script_13.model)
ghpython_script_14 = GhPythonScript(model=data_3, Analysis=python_6.a)  # -> out, AnalysisModel, textFile; inputs numIncr: Int32
# ---------- ghpython_script_14: Python ----------
import opensees.openseesGH as alpaca
import Rhino.RhinoDoc
import Grasshopper as gh
import copy
import rhinoscriptsyntax as rs
import os
import time


FolderPath = rs.DocumentPath()
os.chdir(FolderPath)

outputFileName = 'openSeesModel'

for dirpath, dirnames, filenames in os.walk(FolderPath):
    for filename in filenames:
        if filename == outputFileName:
            file = os.path.join(dirpath,outputFileName)
            os.remove(file)


# create a copy

AnalysisModel = copy.copy(model)
AnalysisModel.py = list(AnalysisModel.py)


AnalysisModel.py.append(Analysis.write_tcl())
#AnalysisModel.StaticAnalysis(numIncr)
AnalysisModel.py.append("wipe")


textFile = AnalysisModel.py

time_start = time.clock()

AnalysisModel.writeFile(outputFileName)

time_elapsed = (time.clock() - time_start)
print("Writing Time {}".format(time_elapsed))



time_start = time.clock()

a, msg = AnalysisModel.runOpensees('tcl')

time_elapsed = (time.clock() - time_start)
print("Analyses Time {}".format(time_elapsed))

#ghenv.Component.AddRuntimeMessage(gh.Kernel.GH_RuntimeMessageLevel.Error, msg)
# ---------- end ghpython_script_14 ----------
python_9 = GhPythonScript(Model=ghpython_script_14.AnalysisModel)  # -> out, a, b
# ---------- python_9: Python ----------
a = []
for item in Model.shells:
    a.append(item.Mesh)

b = []

for item in Model.beams:
    b.append(item.Crv)
# ---------- end python_9 ----------
