# Grasshopper definition hdf5pyTest_Rev01.gh (Grasshopper 1.0.7)

# Displacement
python = GhPythonScript()  # -> out, a, b, c
# ---------- python: Python ----------
import sys
import System
import clr
import clrtype

my_module_name = "aaa_one_other_unique_name" # replace this with something unique that doesn't collide with a real module!
my_module = sys.modules.setdefault(my_module_name, type(sys)(my_module_name))
clr.AddReferenceToFileAndPath(r"C:\Users\FORMAT\Desktop\hdf5Test\HDF5CSharp.dll")

from HDF5CSharp import Hdf5

try:
    Displacementss = my_module.Displacementss
except AttributeError:
    type_2d = type(System.Array.CreateInstance(float, 1, 1))

    class Displacementss(object):
        __metaclass__ = clrtype.ClrClass

        @property
        @clrtype.accepts()
        @clrtype.returns(type_2d)
        def STEP_1(self): return self.__data
        
        @STEP_1.setter
        @clrtype.accepts(type_2d)
        @clrtype.returns()
        def STEP_1(self, value): self.__data = value

        @property
        @clrtype.accepts()
        @clrtype.returns(type_2d)
        def STEP_2(self): return self.__data
        
        @STEP_2.setter
        @clrtype.accepts(type_2d)
        @clrtype.returns()
        def STEP_2(self, value): self.__data = value
        
    my_module.Displacementss = Displacementss

a = []
b = []
c = []

fileId = 0

fileId = Hdf5.OpenFile(r"C:\Users\FORMAT\Desktop\hdf5Test\recorder.hdf5", True)
print(fileId)

#result = Hdf5.ReadObject[Coordina](fileId, "/MODEL_STAGE[1]/MODEL/NODES")
result = Hdf5.ReadObject[Displacementss](fileId, "/MODEL_STAGE[1]/RESULTS/ON_NODES/DISPLACEMENT/DATA")

try:
    for i in range(1000):
        a.append( result.STEP_1[i,0])
        b.append( result.STEP_1[i,1])
        c.append( result.STEP_1[i,2])
    Hdf5.CloseFile(fileId)
except:
    pass
# ---------- end python ----------
# Format Engineers CAD Information Issue Disclaimer
# 
# Project: PROJECT NAME
# 
# You should use this model for reference purposes only to assist in co-ordinating your work and is supplementary to formally issued drawings. Once the data is introduced into your own CAD or other system Format Engineers Ltd. can take no responsibility for its accuracy.
# 
# The last set of formally issued paper drawings are the contractual documents which represent the current stage of design development. If you have any queries, please contact the project CAD co-ordinator or the CAD Development Team.
# 
# Changes:
# 
# YYYY-MM-DD: Summary of changes
# 
# Usage notes:
# 
# This definition includes a basic implementation of Merbarki's Farthest Point Seeding algorithm (2005), adapted for tracing lines of principal curvature on NURBS surfaces. Requires modified Triangle.NET, if this isn't attached then... good luck! There are currently two main limitations: (a) this implementation measures density in parameter space, and (b) it doesn't include the dynamic refinement of density that Mebarki suggests.
# Coordinate
python_2 = GhPythonScript()  # -> out, a, b, c
# ---------- python_2: Python ----------
import sys
import System
import clr
import clrtype

my_module_name = "some_unique_name" # replace this with something unique that doesn't collide with a real module!
my_module = sys.modules.setdefault(my_module_name, type(sys)(my_module_name))
clr.AddReferenceToFileAndPath(r"C:\Users\FORMAT\Desktop\hdf5Test\HDF5CSharp.dll")

from HDF5CSharp import Hdf5

try:
    Coordina = my_module.Coordina
except AttributeError:
    type_2d = type(System.Array.CreateInstance(float, 1, 1))

    class Coordina(object):
        __metaclass__ = clrtype.ClrClass

        @property
        @clrtype.accepts()
        @clrtype.returns(type_2d)
        def COORDINATES(self): return self.__coords
        
        @COORDINATES.setter
        @clrtype.accepts(type_2d)
        @clrtype.returns()
        def COORDINATES(self, value): self.__coords = value

    my_module.Coordina = Coordina

a = []
b = []
c = []

fileId = 0

fileId = Hdf5.OpenFile(r"C:\Users\FORMAT\Desktop\hdf5Test\recorder.hdf5", True)
print(fileId)

result = Hdf5.ReadObject[Coordina](fileId, "/MODEL_STAGE[1]/MODEL/NODES")
try:
    for i in range(1000):
        a.append( result.COORDINATES[i,0])
        b.append( result.COORDINATES[i,1])
        c.append( result.COORDINATES[i,2])
    Hdf5.CloseFile(fileId)
except:
    pass
# ---------- end python_2 ----------
number_slider = Slider(2.93, range=-5..5)
# Displacement
python_3 = GhPythonScript()  # -> out, a, b, c; same code as python
vec = VectorXYZ(XComponent=python.a, YComponent=python.b, ZComponent=python.c)  # -> Vector, Length
pt = ConstructPoint(XCoordinate=python_2.a, YCoordinate=python_2.b, ZCoordinate=python_2.c)
vec_2 = VectorXYZ(XComponent=python_3.a, YComponent=python_3.b, ZComponent=python_3.c)  # -> Vector, Length
multiplication = Multiplication(A=vec.Vector, B=Slider(2.93, range=-5..5))
data = Data(vec.Vector)
data_2 = Data([Vector(0, 0, 0), Vector(0.003324756259, 0.002517761921, -0.001334657534), Vector(0.003696783618, 0.002728455597, -0.001137447824), Vector(0, 0, 0), Vector(0, 0, 0), Vector(0.002957014774, 0.002328014526, -0.001525856366)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])
panel = Panel(data)
panel_2 = Panel(data_2)
move = Move(Geometry=pt, Motion=multiplication)  # -> Geometry, Transform
preview = CustomPreview(
    Geometry=move.Geometry,
    Material={diffuse=RGB(221, 160, 221), emission=RGB(66, 48, 66), shine=0.5, specular=RGB(255, 255, 255), transparency=0})
