# Grasshopper definition hdf5pyTest_Rev02.gh (Grasshopper 1.0.7)
# plug-ins: Pufferfish

int = Integer(Slider(9, range=0..9))
python = GhPythonScript(step=int)  # -> out, displacement, rotation
# ---------- python: Python ----------
import sys
import System
import clr
import clrtype
import Rhino.Geometry as rg

my_module_name = "aaa_one_other_unique_name" # replace this with something unique that doesn't collide with a real module!
my_module = sys.modules.setdefault(my_module_name, type(sys)(my_module_name))
clr.AddReferenceToFileAndPath(r"C:\Users\FORMAT\Desktop\hdf5Test\HDF5CSharp.dll")

from HDF5CSharp import Hdf5

try:
    Steps = my_module.Steps
except AttributeError:
    type_2d = type(System.Array.CreateInstance(float, 1, 1))

    class Steps(object):
        __metaclass__ = clrtype.ClrClass
        _clrfields = {"STEP_{}".format(i): type_2d for i in range(1000)} # it will work for model with less than 1000 steps

    my_module.Steps = Steps



fileId = Hdf5.OpenFile(r"C:\Users\FORMAT\Desktop\hdf5Test\recorder.hdf5", True)
numberOfPoints = 304 #


displacementResult = Hdf5.ReadObject[Steps](fileId, "/MODEL_STAGE[1]/RESULTS/ON_NODES/DISPLACEMENT/DATA")

displacement = []



for i in range(numberOfPoints):
    x = getattr(displacementResult, 'STEP_{}'.format(step))[i,0]
    y = getattr(displacementResult, 'STEP_{}'.format(step))[i,1]
    z = getattr(displacementResult, 'STEP_{}'.format(step))[i,2]
    displacement.append(rg.Vector3d(x,y,z))




rotationResult = Hdf5.ReadObject[Steps](fileId, "/MODEL_STAGE[1]/RESULTS/ON_NODES/ROTATION/DATA")

rotation = []


for i in range(numberOfPoints):
    x = getattr(rotationResult, 'STEP_{}'.format(step))[i,0]
    y = getattr(rotationResult, 'STEP_{}'.format(step))[i,1]
    z = getattr(rotationResult, 'STEP_{}'.format(step))[i,2]
    rotation.append(rg.Vector3d(x,y,z))
# ---------- end python ----------
displacement = Panel(python.displacement)
# Coordinate
python_2 = GhPythonScript()  # -> out, a, b, c
# ---------- python_2: Python ----------
import sys
import System
import clr
import clrtype

my_module_name = "some_unique_name" # replace this with something unique that doesn't collide with a real module!
my_module = sys.modules.setdefault(my_module_name, type(sys)(my_module_name))
clr.AddReferenceToFileAndPath(r"C:\Users\FORMAT\Desktop\hdf5Test\HDF5CSharp.dll")

from HDF5CSharp import Hdf5

try:
    Coordina = my_module.Coordina
except AttributeError:
    type_2d = type(System.Array.CreateInstance(float, 1, 1))

    class Coordina(object):
        __metaclass__ = clrtype.ClrClass

        @property
        @clrtype.accepts()
        @clrtype.returns(type_2d)
        def COORDINATES(self): return self.__coords
        
        @COORDINATES.setter
        @clrtype.accepts(type_2d)
        @clrtype.returns()
        def COORDINATES(self, value): self.__coords = value

    my_module.Coordina = Coordina

a = []
b = []
c = []

fileId = 0

fileId = Hdf5.OpenFile(r"C:\Users\FORMAT\Desktop\hdf5Test\recorder.hdf5", True)
print(fileId)

result = Hdf5.ReadObject[Coordina](fileId, "/MODEL_STAGE[1]/MODEL/NODES")
try:
    for i in range(1000):
        a.append( result.COORDINATES[i,0])
        b.append( result.COORDINATES[i,1])
        c.append( result.COORDINATES[i,2])
    Hdf5.CloseFile(fileId)
except:
    pass
# ---------- end python_2 ----------
pt = ConstructPoint(XCoordinate=python_2.a, YCoordinate=python_2.b, ZCoordinate=python_2.c)
multiplication = Multiplication(A=python.displacement, B=Slider(5, range=-5..5))
vlen = VectorLength(Vector=python.displacement)
bnd = Bounds(Numbers=vlen)
remap = RemapNumbers(Value=vlen, Source=bnd, Target=Domain(0, 1))  # -> Mapped, Clipped
move = Move(Geometry=pt, Motion=multiplication)  # -> Geometry, Transform
gradientlibrary = GradientLibrary(gradIndex=11)  # -> reverse(colors); inputs gradIndex: Int32
#   port colors: A series of colors to be plugged into the "Ladybug_Legend Parameters" component.
# ---------- gradientlibrary: Python ----------
"""
Preset of gradient colors perfect for Data Visualisation
    Inputs:
        gradIndex: An index refering to one of the following possible gradients:
            0 - Orignal Ladybug
            1 - Nuanced Ladybug
            2 - Multi-colored Ladybug
            3 - Ecotect
            4 - Thermal Comfort Percentage
            5 - Thermal Comfort Colors
            6 - Shade Benefit/Harm
            7 - Shade Harm
            8 - Shade Benefit
            9 - CFD Colors 1
            10 - Radiation Benefit
            11 - Gsa10 Colour
            12 - Gsa9 Colour
    Returns:
        customColors: A series of colors.
"""

ghenv.Component.Name = "Gradient Library"
ghenv.Component.NickName = 'GradientLibrary'
#ghenv.Component.Message = 'GradientLibrary\nWIP'

import scriptcontext as sc
import Grasshopper.Kernel as gh
import System

gradientLibrary = {
        0: [System.Drawing.Color.FromArgb(75, 107, 169), System.Drawing.Color.FromArgb(115, 147, 202), System.Drawing.Color.FromArgb(170, 200, 247), System.Drawing.Color.FromArgb(193, 213, 208), System.Drawing.Color.FromArgb(245, 239, 103), System.Drawing.Color.FromArgb(252, 230, 74), System.Drawing.Color.FromArgb(239, 156, 21), System.Drawing.Color.FromArgb(234, 123, 0), System.Drawing.Color.FromArgb(234, 74, 0), System.Drawing.Color.FromArgb(234, 38, 0)],
        1: [System.Drawing.Color.FromArgb(49,54,149), System.Drawing.Color.FromArgb(69,117,180), System.Drawing.Color.FromArgb(116,173,209), System.Drawing.Color.FromArgb(171,217,233), System.Drawing.Color.FromArgb(224,243,248), System.Drawing.Color.FromArgb(255,255,191), System.Drawing.Color.FromArgb(254,224,144), System.Drawing.Color.FromArgb(253,174,97), System.Drawing.Color.FromArgb(244,109,67), System.Drawing.Color.FromArgb(215,48,39), System.Drawing.Color.FromArgb(165,0,38)],
        2: [System.Drawing.Color.FromArgb(4,25,145), System.Drawing.Color.FromArgb(7,48,224), System.Drawing.Color.FromArgb(7,88,255), System.Drawing.Color.FromArgb(1,232,255), System.Drawing.Color.FromArgb(97,246,156), System.Drawing.Color.FromArgb(166,249,86), System.Drawing.Color.FromArgb(254,244,1), System.Drawing.Color.FromArgb(255,121,0), System.Drawing.Color.FromArgb(239,39,0), System.Drawing.Color.FromArgb(138,17,0)],
        3: [System.Drawing.Color.FromArgb(0,0,255), System.Drawing.Color.FromArgb(53,0,202), System.Drawing.Color.FromArgb(107,0,148), System.Drawing.Color.FromArgb(160,0,95), System.Drawing.Color.FromArgb(214,0,41), System.Drawing.Color.FromArgb(255,12,0), System.Drawing.Color.FromArgb(255,66,0), System.Drawing.Color.FromArgb(255,119,0), System.Drawing.Color.FromArgb(255,173,0), System.Drawing.Color.FromArgb(255,226,0), System.Drawing.Color.FromArgb(255,255,0)],
        4: [System.Drawing.Color.FromArgb(0,0,0), System.Drawing.Color.FromArgb(110,0,153), System.Drawing.Color.FromArgb(255,0,0), System.Drawing.Color.FromArgb(255,255,102), System.Drawing.Color.FromArgb(255,255,255)],
        5: [System.Drawing.Color.FromArgb(0,136,255), System.Drawing.Color.FromArgb(200,225,255), System.Drawing.Color.FromArgb(255,255,255), System.Drawing.Color.FromArgb(255,230,230), System.Drawing.Color.FromArgb(255,0,0)],
        6: [System.Drawing.Color.FromArgb(5,48,97), System.Drawing.Color.FromArgb(33,102,172), System.Drawing.Color.FromArgb(67,147,195), System.Drawing.Color.FromArgb(146,197,222), System.Drawing.Color.FromArgb(209,229,240), System.Drawing.Color.FromArgb(255,255,255), System.Drawing.Color.FromArgb(253,219,199), System.Drawing.Color.FromArgb(244,165,130), System.Drawing.Color.FromArgb(214,96,77), System.Drawing.Color.FromArgb(178,24,43), System.Drawing.Color.FromArgb(103,0,31)],
        7: [System.Drawing.Color.FromArgb(255,255,255), System.Drawing.Color.FromArgb(253,219,199), System.Drawing.Color.FromArgb(244,165,130), System.Drawing.Color.FromArgb(214,96,77), System.Drawing.Color.FromArgb(178,24,43), System.Drawing.Color.FromArgb(103,0,31)],
        8: [System.Drawing.Color.FromArgb(255,255,255), System.Drawing.Color.FromArgb(209,229,240), System.Drawing.Color.FromArgb(146,197,222), System.Drawing.Color.FromArgb(67,147,195), System.Drawing.Color.FromArgb(33,102,172), System.Drawing.Color.FromArgb(5,48,97)],
        9: [System.Drawing.Color.FromArgb(0,16,120), System.Drawing.Color.FromArgb(38,70,160), System.Drawing.Color.FromArgb(5,180,222), System.Drawing.Color.FromArgb(16,180,109), System.Drawing.Color.FromArgb(59,183,35), System.Drawing.Color.FromArgb(143,209,19), System.Drawing.Color.FromArgb(228,215,29), System.Drawing.Color.FromArgb(246,147,17), System.Drawing.Color.FromArgb(243,74,0), System.Drawing.Color.FromArgb(255,0,0)],
        10: [System.Drawing.Color.FromArgb(0,191,48), System.Drawing.Color.FromArgb(255,238,184), System.Drawing.Color.FromArgb(255,0,0)],
        11: [System.Drawing.Color.FromArgb(204,0,71), System.Drawing.Color.FromArgb(255,182,71), System.Drawing.Color.FromArgb(206,255,115), System.Drawing.Color.FromArgb(26,180, 214),System.Drawing.Color.FromArgb(0,0,207)],
        12: [System.Drawing.Color.FromArgb(255, 51, 51), System.Drawing.Color.FromArgb(255, 170, 51), System.Drawing.Color.FromArgb(255, 255, 51), System.Drawing.Color.FromArgb(170, 255, 125), System.Drawing.Color.FromArgb(51, 255, 231), System.Drawing.Color.FromArgb(51, 170, 255), System.Drawing.Color.FromArgb(51,51, 255)]}
colors = gradientLibrary[gradIndex]
# ---------- end gradientlibrary ----------

num = Number(vlen)
bnd_2 = Bounds(Numbers=flatten(num))
cluster = Cluster(
    col=gradientlibrary,
    C=ColourSwatch(SwatchColor=RGB(0, 0, 0)),
    D=bnd_2,
    X=Slider(451, range=0..1000),
    Y=Slider(650, range=0..1000))

twnthrucols = TweenThroughColors(
    Colors=gradientlibrary,
    Factor=remap.Mapped,
    Normalized=True,
    Equalized=False,
    Weighted=False,
    Degree=3,
    InterpolationType=0,
    Alpha=True)
preview = CustomPreview(Geometry=move.Geometry, Material=twnthrucols)

# ==== cluster Cluster
gggrasshoppersettings = GgGrasshopperSettings(
    SettingsData_IFCSettings_Format="STEP",
    SettingsData_IFCSettings_GenerateOwnerHistory=True,
    SettingsData_IFCSettings_IdentifyObsolete=True,
    SettingsData_IFCSettings_LastUsedUnits="Meters",
    SettingsData_IFCSettings_Radians=True,
    SettingsData_IFCSettings_RepMapExport="NONE",
    SettingsData_IFCSettings_Target="Universal",
    SettingsData_IFCSettings_VersionIFC="IFC2x3",
    SettingsData_RevitSettings_Format="STEP",
    SettingsData_RevitSettings_GenerateOwnerHistory=True,
    SettingsData_RevitSettings_IdentifyObsolete=True,
    SettingsData_RevitSettings_LastUsedUnits="Meters",
    SettingsData_RevitSettings_Radians=True,
    SettingsData_RevitSettings_RepMapExport="NONE",
    SettingsData_RevitSettings_Target="Universal",
    SettingsData_RevitSettings_VersionIFC="IFC4")
Y = ClusterInput()
col = ClusterInput()
X = ClusterInput()
C = ClusterInput()
D = ClusterInput()
col_2 = Colour(col)
lng = ListLength(List=col_2)
multiplication = Multiplication(A=lng, B=Slider(5, range=0..10))
item = ListItem(List=col_2, Index=0, Wrap=True)  # -> graft(Item1), Item
graft = GraftTree(Tree=col_2, IncludeEmptyLists=True, IncludeNullItems=True)
entwine = Entwine(Branch00=graft, Branch01=item.Item1, FlattenInputs=True)  # -> graft(Result)
dup = DuplicateData(Data=entwine, Number=2, Order=True)  # -> simplify(Data)
flatten = FlattenTree(Tree=dup, Path="{0}")
number_slider = Slider(48, range=1..70)
number_slider_2 = Slider(12, range=1..50)
Y_2 = UnitY(Factor=1)  # -> expr("-x", UnitVector)
panel = Panel("11")
range = Range(Domain=D, Steps=lng)  # -> expr("Round(x,2)", Range)
panel_2 = Panel("2")
vec = VectorXYZ(XComponent=number_slider_2, YComponent=0, ZComponent=0)  # -> Vector, Length

rectangle = Rectangle(Plane=PlaneXY(0, 0, 0), XSize="10", YSize="0.5", Radius=0)  # -> Rectangle, Length
boundary = BoundarySurfaces(Edges=rectangle.Rectangle)
divide = DivideDomain(Domain=boundary, UCount=lng, VCount="1")
subsrf = Isotrim(Surface=boundary, Domain=divide)
explode = MeshExplode(Mesh=subsrf, Interpolate=False)
mcol = MeshColours(Mesh=explode, Colours=graft(col_2))  # -> flatten(Mesh)
mjoin = MeshJoin(Meshes=mcol)
weldvertices = MeshWeldVertices(Mesh=mjoin, Tolerance=0.01)  # -> RuntimeMessage, Mesh
pt = ConstructPoint(XCoordinate=X, YCoordinate=Y, ZCoordinate=0)

demesh = DeconstructMesh(Mesh=weldvertices.Mesh)  # -> Vertices, Faces, Colours, Normals
multiplication_2 = Multiplication(A=number_slider, B="10")
sort_pt = SortPoints(Points=demesh.Vertices)  # -> Points, Indices
pdecon = Deconstruct(Point=sort_pt.Points)  # -> XComponent, YComponent, ZComponent
mspray = MeshSpray(Mesh=weldvertices.Mesh, Points=sort_pt.Points, Colours=flatten, SprayMode=10)
division = Division(A=multiplication_2, B="2")
smaller = SmallerThan(FirstNumber=pdecon.YComponent, SecondNumber="0.1")  # -> SmallerThan, OrEqualTo
X_2 = UnitX(Factor=division)
rev = Reverse(Vector=X_2)
cull = CullPattern(List=sort_pt.Points, CullPattern=smaller.SmallerThan)
intcrv = Interpolate(Vertices=cull, Degree=3, Periodic=False, KnotStyle=1)  # -> Curve, Length, Domain
multiplication_3 = Multiplication(A=number_slider, B="10")
move = Move(Geometry=pt, Motion=rev)  # -> Geometry, Transform
X_3 = UnitX(Factor=multiplication_3)
divide_2 = DivideCurve(Curve=intcrv.Curve, Count=multiplication, Kinks=False)  # -> Points, Tangents, Parameters
move_2 = Move(Geometry=move.Geometry, Motion=X_3)  # -> Geometry, Transform
line = LineSDL(Start=divide_2.Points, Direction=Y_2, Length="0.1")

meshtoscreen = RenderMeshToScreen(Mesh=mspray, Location=move.Geometry, ScaleFactor=number_slider, Depth=0.95, Fixed=True, m_scWithvp=False)

dist = Distance(PointA=move.Geometry, PointB=move_2.Geometry)
range_2 = Range(Domain=dist, Steps=lng)
medges = MeshEdges(Mesh=weldvertices.Mesh)  # -> NakedEdges, InteriorEdges, NonManifoldEdges
vec_2 = VectorXYZ(XComponent=range_2, YComponent=Slider(30, range=0..100), ZComponent=0)  # -> Vector, Length
addition = Addition(A=move.Geometry, B=vec_2.Vector)
crvtoscreen = RenderCurveToScreen(
    Curve=[medges.NakedEdges, medges.InteriorEdges, medges.NonManifoldEdges, line],
    Location=move.Geometry,
    ScaleFactor=number_slider,
    Color=C,
    Thickness=1,
    Depth=0.95,
    Fixed=True,
    m_scWithvp=False)
subtraction = Subtraction(A=addition, B=vec.Vector)
texttoscreen = RenderTextToScreen(Text=range, Location=subtraction, Size=number_slider_2, Color=C, Font="Iosevka", m_scWithvp=False)
