# Grasshopper definition LocalAxis.gh (Grasshopper 1.0.7)
# plug-ins: Alpaca4d, BH.UI.Grasshopper

i_section = ISectionAlpaca4d(Height=0.3, TopFlangeWidth=0.15, TopFlangeThickness=0.02, BottomFlangeWidth=0.2, BottomFlangeThickness=0.02, Web=0.02)
rectanglehollowcs = RectangleHollowAlpaca4d(Width=0.3, Height=0.6, Web=0.02, TopFlange=0.02, BottomFlange=0.02)
circlecs = CircleCSAlpaca4d(Diameter=0.15, Thickness=0.01)
rectanglecs = RectangleCSAlpaca4d(Width=0.3, Height=0.6)
X = UnitX(Factor=1)
pt = Point(Point(0, 0, 0))
list = ValueList({"ipe": 0, "rect": 1, "hollowSquare": 2, "circle": 3}, selected="hollowSquare")
line = LineSDL(Start=pt, Direction=X, Length="12")
filter = StreamFilter(Gate=list, Stream0=i_section, Stream1=rectanglecs, Stream2=rectanglehollowcs, Stream3=circlecs)
python = GhPythonScript()  # -> Out, A
pframe = PerpFrame(Curve=reparameterize(line), Parameter="0.50")
pt_2 = Point(pframe)
vec = VectorXYZ(XComponent=Slider(0.2, range=0..1), YComponent=Slider(0.22, range=0..1), ZComponent=Slider(1, range=0..1))  # -> Vector, Length
Y = UnitY(Factor=1)
Z = UnitZ(Factor=1)
geo = Geometry()
end = EndPoints(Curve=line)  # -> Start, End
align = AlignPlane(Plane=pframe, Direction=vec.Vector)  # -> Plane, Angle
Z_2 = UnitZ(Factor="1000000")
force_beam_column = ForceBeamColumnAlpaca4d(Line=line, Section=filter, ZAxis=[Z, Y])
support = SupportAlpaca4d(Point=end.Start, Tx=True, Ty=True, Tz=True, Rx=True, Ry=True, RZ=True)
point_load = PointLoadAlpaca4d(Point=end.End, Force=Z_2, Moment=Vector(0, 0, 0))
graft = GraftTree(Tree=force_beam_column, IncludeEmptyLists=True, IncludeNullItems=True)
getproperty = GetProperty(Obj=graft, PropName="Section", Component="{ .GetProperty")
getproperty_2 = GetProperty(Obj=graft, PropName="Curve", Component="{ .GetProperty")
assemble_model = AssembleModelAlpaca4d(Element=graft, Support=support, Load=point_load, Tollerance=0.01)
analysissettings = AnalysisSettingsAlpaca4d()
graft_2 = GraftTree(Tree=graft, IncludeEmptyLists=True, IncludeNullItems=True)
explode = Explode(Component="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")
getproperty_3 = GetProperty(Obj=getproperty, PropName="Izz", Component="{ .GetProperty")
getproperty_4 = GetProperty(Obj=getproperty, PropName="Iyy", Component="{ .GetProperty")
getproperty_5 = GetProperty(Obj=getproperty, PropName="Material", Component="{ .GetProperty")
len = Length(Curve=getproperty_2)
vlen = VectorLength(Vector=Z_2)
bang = ExplodeTree(Data=assemble_model)  # -> Branch0, Branch1
ra = RunAnalysisAlpaca4d(AlpacaModel=bang.Branch1, Settings=analysissettings)  # -> Log, AlpacaModel
ra_2 = RunAnalysisAlpaca4d(AlpacaModel=bang.Branch0, Settings=analysissettings)  # -> Log, AlpacaModel
panel = Panel(getproperty_4)
getproperty_6 = GetProperty(Obj=getproperty_5, PropName="E", Component="{ .GetProperty")
bang_2 = ExplodeTree(Data=[getproperty_3, getproperty_4])  # -> Branch0, Branch1
getproperty_7 = GetProperty(Obj=graft, PropName="Section", Component="{ .GetProperty")
getproperty_8 = GetProperty(Obj=graft, PropName="GeomTransf", Component="{ .GetProperty")
getproperty_9 = GetProperty(Obj=graft, PropName="LocalZAxis", Component="{ .GetProperty")
python_2 = GhPythonScript(P=vlen, L=len, E=getproperty_6, I=bang_2.Branch0)  # -> out, a
# ---------- python_2: Python ----------
__author__ = "MarcoPellegrinoKonsu"
__version__ = "2022.09.09"

import rhinoscriptsyntax as rs

a = P * L**3/(3*E*I)
# ---------- end python_2 ----------
nd = NodalDisplacementsAlpaca4d(AlpacaModel=ra.AlpacaModel, History=False, Step=0)  # -> Displacement, Rotation, port, Velocity, Acceleration
nd_2 = NodalDisplacementsAlpaca4d(AlpacaModel=ra_2.AlpacaModel, History=False, Step=0)  # -> Displacement, Rotation, port, Velocity, Acceleration
panel_2 = Panel(python_2.a)
panel_3 = Panel(getproperty_9)
getproperty_10 = GetProperty(Obj=getproperty_7, PropName="Curve", Component="{ .GetProperty")
panel_4 = Panel(nd.Displacement)
panel_5 = Panel(nd_2.Displacement)
explode_2 = Explode(Object=getproperty_8, Component="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")  # -> Type, Line, Id, LocalZ, LocalY
bang_3 = ExplodeTree(Data=panel_2)  # -> Branch0, Branch1
extr = Extrude()
item = ListItem(List=panel_5, Index="1", Wrap=True)
panel_6 = Panel(explode_2.LocalZ)
panel_7 = Panel(explode_2.LocalY)
item_2 = ListItem(List=panel_4, Index="1", Wrap=True)
merge = Merge(Data1=flatten(item_2), Data2=flatten(item))
end_2 = EndPoints(Curve=explode_2.Line)  # -> Start, End
data = Data(flatten(bang_3.Branch0))
midpt = CurveMiddle(Curve=explode_2.Line)
data_2 = Data(flatten(merge))
pl = ConstructPlane(Origin=[end_2.Start, end_2.End], XAxis=explode_2.LocalZ, YAxis=explode_2.LocalY)
panel_8 = Panel(data_2)
panel_9 = Panel(data)
orient = Orient(Geometry=getproperty_10, Source=PlaneXY(0, 0, 0), Target=pl)  # -> Geometry, Transform
vdisex = VectorDisplayEx(Point=midpt, Vector=panel_7, Colour=ColourSwatch(SwatchColor=RGB(48, 204, 0)), Width="3")
vdisex_2 = VectorDisplayEx(Point=midpt, Vector=panel_6, Colour=ColourSwatch(SwatchColor=RGB(0, 118, 161)), Width="3")
pdecon = Deconstruct(Point=panel_8)  # -> XComponent, YComponent, ZComponent
python_3 = GhPythonScript(X=orient.Geometry)  # -> Out, A
similar = Similarity(FirstNumber=pdecon.ZComponent, SecondNumber=panel_9, Threshold="3")  # -> Similarity, AbsoluteDifference
divide = DivideCurve(Curve=orient.Geometry, Count=10, Kinks=False)  # -> Points, Tangents, Parameters
pline = PolyLine(Vertices=divide.Points, Closed=invert(False))
ml = MeshLoftAlpaca4d(Polylines=orient.Geometry)
merge_2 = Merge(Data1=ColourSwatch(SwatchColor=RGB(255, 0, 0)), Data2=ColourSwatch(SwatchColor=RGB(77, 255, 0)))
item_3 = ListItem(List=merge_2, Index=similar.Similarity, Wrap=True)
preview = CustomPreview(Geometry=ml, Material=ColourSwatch(SwatchColor=RGBA(255, 255, 255, 112)))
legend = Legend(Colour=item_3, Tags=similar.Similarity, LegendType=1)

i_section_2 = ISectionAlpaca4d(Height=0.3, TopFlangeWidth=0.15, TopFlangeThickness=0.02, BottomFlangeWidth=0.2, BottomFlangeThickness=0.02, Web=0.02)
rectanglehollowcs_2 = RectangleHollowAlpaca4d(Width=0.3, Height=0.6, Web=0.02, TopFlange=0.02, BottomFlange=0.02)
circlecs_2 = CircleCSAlpaca4d(Diameter=0.15, Thickness=0.01)
rectanglecs_2 = RectangleCSAlpaca4d(Width=0.3, Height=0.6)
X_2 = UnitX(Factor=1)
pt_3 = Point(Point(0, 0, 0))
list_2 = ValueList({"ipe": 0, "rect": 1, "hollowSquare": 2, "circle": 3}, selected="hollowSquare")
line_2 = LineSDL(Start=pt_3, Direction=X_2, Length="12")
filter_2 = StreamFilter(Gate=list_2, Stream0=i_section_2, Stream1=rectanglecs_2, Stream2=rectanglehollowcs_2, Stream3=circlecs_2)
python_4 = GhPythonScript()  # -> Out, A
pframe_2 = PerpFrame(Curve=reparameterize(line_2), Parameter="0.50")
pt_4 = Point(pframe_2)
vec_2 = VectorXYZ(XComponent=Slider(0.2, range=0..1), YComponent=Slider(0.22, range=0..1), ZComponent=Slider(1, range=0..1))  # -> Vector, Length
Y_2 = UnitY(Factor=1)
Z_3 = UnitZ(Factor=1)
geo_2 = Geometry()
end_3 = EndPoints(Curve=line_2)  # -> Start, End
align_2 = AlignPlane(Plane=pframe_2, Direction=vec_2.Vector)  # -> Plane, Angle
Z_4 = UnitZ(Factor="1000000")
force_beam_column_2 = ForceBeamColumnAlpaca4d(Line=line_2, Section=filter_2, ZAxis=[Z_3, Y_2])
support_2 = SupportAlpaca4d(Point=end_3.Start, Tx=True, Ty=True, Tz=True, Rx=True, Ry=True, RZ=True)
point_load_2 = PointLoadAlpaca4d(Point=end_3.End, Force=Z_4, Moment=Vector(0, 0, 0))
graft_3 = GraftTree(Tree=force_beam_column_2, IncludeEmptyLists=True, IncludeNullItems=True)
getproperty_11 = GetProperty(Obj=graft_3, PropName="Section", Component="{ .GetProperty")
getproperty_12 = GetProperty(Obj=graft_3, PropName="Curve", Component="{ .GetProperty")
analysissettings_2 = AnalysisSettingsAlpaca4d()
graft_4 = GraftTree(Tree=graft_3, IncludeEmptyLists=True, IncludeNullItems=True)
explode_3 = Explode(Component="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")
vlen_2 = VectorLength(Vector=Z_4)
getproperty_13 = GetProperty(Obj=getproperty_11, PropName="Izz", Component="{ .GetProperty")
getproperty_14 = GetProperty(Obj=getproperty_11, PropName="Iyy", Component="{ .GetProperty")
getproperty_15 = GetProperty(Obj=getproperty_11, PropName="Material", Component="{ .GetProperty")
len_2 = Length(Curve=getproperty_12)
panel_10 = Panel(getproperty_14)
getproperty_16 = GetProperty(Obj=getproperty_15, PropName="E", Component="{ .GetProperty")
bang_4 = ExplodeTree(Data=[getproperty_13, getproperty_14])  # -> Branch0, Branch1
getproperty_17 = GetProperty(Obj=graft_3, PropName="Section", Component="{ .GetProperty")
getproperty_18 = GetProperty(Obj=graft_3, PropName="GeomTransf", Component="{ .GetProperty")
getproperty_19 = GetProperty(Obj=graft_3, PropName="LocalZAxis", Component="{ .GetProperty")
panel_11 = Panel(getproperty_19)
getproperty_20 = GetProperty(Obj=getproperty_17, PropName="Curve", Component="{ .GetProperty")
explode_4 = Explode(Object=getproperty_18, Component="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")  # -> Type, Line, Id, LocalZ, LocalY
extr_2 = Extrude()
panel_12 = Panel(explode_4.LocalZ)
panel_13 = Panel(explode_4.LocalY)
end_4 = EndPoints(Curve=explode_4.Line)  # -> Start, End
midpt_2 = CurveMiddle(Curve=explode_4.Line)
pl_2 = ConstructPlane(Origin=[end_4.Start, end_4.End], XAxis=explode_4.LocalZ, YAxis=explode_4.LocalY)
orient_2 = Orient(Geometry=getproperty_20, Source=PlaneXY(0, 0, 0), Target=pl_2)  # -> Geometry, Transform
vdisex_3 = VectorDisplayEx(Point=midpt_2, Vector=panel_13, Colour=ColourSwatch(SwatchColor=RGB(48, 204, 0)), Width="3")
vdisex_4 = VectorDisplayEx(Point=midpt_2, Vector=panel_12, Colour=ColourSwatch(SwatchColor=RGB(0, 118, 161)), Width="3")
python_5 = GhPythonScript(X=orient_2.Geometry)  # -> Out, A
divide_2 = DivideCurve(Curve=orient_2.Geometry, Count=10, Kinks=False)  # -> Points, Tangents, Parameters
pline_2 = PolyLine(Vertices=divide_2.Points, Closed=invert(False))
ml_2 = MeshLoftAlpaca4d(Polylines=orient_2.Geometry)
merge_3 = Merge(Data1=ColourSwatch(SwatchColor=RGB(255, 0, 0)), Data2=ColourSwatch(SwatchColor=RGB(77, 255, 0)))
preview_2 = CustomPreview(Geometry=ml_2, Material=ColourSwatch(SwatchColor=RGBA(255, 255, 255, 112)))

Z_5 = UnitZ(Factor="1000000")
graft_5 = GraftTree(Tree=force_beam_column_2, IncludeEmptyLists=True, IncludeNullItems=True)
linearload = LinearLoadAlpaca4d(BeamElement=graft_5, Force=Z_5)
num = Number(vlen_2)

assemble_model_2 = AssembleModelAlpaca4d(Element=graft_5, Support=support_2, Load=linearload, Tollerance=0.01)
bang_5 = ExplodeTree(Data=assemble_model_2)  # -> Branch0, Branch1
ra_3 = RunAnalysisAlpaca4d(AlpacaModel=bang_5.Branch1, Settings=analysissettings_2)  # -> Log, AlpacaModel
ra_4 = RunAnalysisAlpaca4d(AlpacaModel=bang_5.Branch0, Settings=analysissettings_2)  # -> Log, AlpacaModel
python_6 = GhPythonScript(P=num, L=len_2, E=getproperty_16, I=bang_4.Branch0)  # -> out, a
# ---------- python_6: Python ----------
__author__ = "MarcoPellegrinoKonsu"
__version__ = "2022.09.09"

import rhinoscriptsyntax as rs

a = P * L**4/(8*E*I)
# ---------- end python_6 ----------
nd_3 = NodalDisplacementsAlpaca4d(AlpacaModel=ra_3.AlpacaModel, History=False, Step=0)  # -> Displacement, Rotation, port, Velocity, Acceleration
nd_4 = NodalDisplacementsAlpaca4d(AlpacaModel=ra_4.AlpacaModel, History=False, Step=0)  # -> Displacement, Rotation, port, Velocity, Acceleration
panel_14 = Panel(python_6.a)
panel_15 = Panel(nd_3.Displacement)
panel_16 = Panel(nd_4.Displacement)
bang_6 = ExplodeTree(Data=panel_14)  # -> Branch0, Branch1
item_4 = ListItem(List=panel_16, Index="1", Wrap=True)
item_5 = ListItem(List=panel_15, Index="1", Wrap=True)
merge_4 = Merge(Data1=flatten(item_5), Data2=flatten(item_4))
data_3 = Data(flatten(bang_6.Branch0))
data_4 = Data(flatten(merge_4))
panel_17 = Panel(data_4)
panel_18 = Panel(data_3)
pdecon_2 = Deconstruct(Point=panel_17)  # -> XComponent, YComponent, ZComponent
similar_2 = Similarity(FirstNumber=pdecon_2.ZComponent, SecondNumber=panel_18, Threshold="3")  # -> Similarity, AbsoluteDifference
item_6 = ListItem(List=merge_3, Index=similar_2.Similarity, Wrap=True)
legend_2 = Legend(Colour=item_6, Tags=similar_2.Similarity, LegendType=1)

panel_19 = Panel(bang_4.Branch0)
modelview = ModelViewAlpaca4d(AlpacaModel=bang_5.Branch0, Extruded=False, Load=False, LoadFactor=1, Support=False, SupportFactor=1, Constraint=False)  # -> AlpacaModel, Info
panel_20 = Panel(modelview.Info)
