# Grasshopper definition OrientationTest.gh (Grasshopper 1.0.7)
# plug-ins: Weaverbird, Alpaca4d

surface = Surface(<surface referenced from the Rhino model>)
mesh_surface = MeshSurface(Surface=surface, UCount="5", VCount="5", Overhang=True, Equalize=False)
weaverbird_s_naked_boundary = WeaverbirdsNakedBoundary(MeshClosedPolylines=mesh_surface)
weaverbird_s_mesh_edges = WeaverbirdsMeshEdges(MeshOrPolylines=mesh_surface)
rectanglehollow_alpaca4d = RectangleHollowAlpaca4d(Width=0.3, Height=0.6, Web=0.02, TopFlange=0.02, BottomFlange=0.02)
explode = Explode(Curve=weaverbird_s_naked_boundary, Recursive=True)  # -> Segments, Vertices
force_beam_column_alpaca4d = ForceBeamColumnAlpaca4d(Line=weaverbird_s_mesh_edges, Section=rectanglehollow_alpaca4d)
support_alpaca4d = SupportAlpaca4d(Point=explode.Vertices, Tx=True, Ty=True, Tz=True, Rx=True, Ry=True, RZ=True)
assemblemodel_alpaca4d = AssembleModelAlpaca4d(Element=force_beam_column_alpaca4d, Tollerance=0.01)  # -> AlpacaModel, MassForce
