# Grasshopper definition deformedColoredModel.gh (Grasshopper 1.0.7)
# plug-ins: Alpaca4d, Kangaroo2 Components, MeshEdit Components, BH.UI.Grasshopper

eim = ElasticIsotropicMaterialAlpaca4d()
explode = Explode(Object=eim, Component="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")  # -> Id, MatName, E, G, Nu, Rho, MaterialDimension, MaterialType
explode_2 = Explode(Object=eim, Component="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")  # -> Id, MatName, E, G, Nu, Rho, MaterialDimension, MaterialType
mplane = MeshPlane(Boundary={Plane=PlaneXY(0, 0, 0), Size=Domain2(u=-10..10, v=-10..10)}, WidthCount="20", HeightCount="20")  # -> Mesh, Area
demesh = DeconstructMesh(Mesh=mplane.Mesh)  # -> Vertices, Faces, Colours, Normals
fs = FiberSectionAlpaca4d(Thickness="0.30", Material=eim)
mc = MeshCorners(Mesh=mplane.Mesh, Angle=2.35619449)
explode_3 = MeshExplode(Mesh=mplane.Mesh, Interpolate=False)
item = ListItem(List=mc, Index=0, Wrap=True)  # -> Item, Item1, Item2, Item3
constant_time_series = ConstantTimeSeriesAlpaca4d(LoadFactor=1)  # -> TimeSeries, Graph
panel = Panel("100")
line = LineSDL(Start=demesh.Vertices, Direction=Vector(0, 0, 1), Length="5")
Z = UnitZ(Factor="1")
rectanglehollowcs = RectangleHollowAlpaca4d(Width=0.3, Height=0.6, Web=0.02, TopFlange=0.02, BottomFlange=0.02)
asdq4 = ASDShellQ4Alpaca4d(Mesh=explode_3, Section=fs, Colour=ColourSwatch(SwatchColor=RGB(115, 87, 87)))
lng = ListLength(List=demesh.Vertices)
jitter = Jitter(List=line, Jitter=1, Seed=2)  # -> Values, Indices
random = Random(Range="1 to 200", Number=lng, Seed=2)
checkerboard = Checkerboard(Mesh=mplane.Mesh)
circlecs = CircleCSAlpaca4d(Diameter="0.30", Thickness=0.01)
support = SupportAlpaca4d(Point=mc, Tx=True, Ty=True, Tz=True, Rx=True, Ry=True, RZ=True)
constant_time_series_2 = ConstantTimeSeriesAlpaca4d(LoadFactor=1)  # -> TimeSeries, Graph
gravity_load = GravityLoadAlpaca4d(TimeSeriesType="Linear", GFactor=1)
Z_2 = UnitZ(Factor="-20")
cull = CullPattern(List=asdq4, CullPattern=checkerboard)
lng_2 = ListLength(List=cull)
split = SplitList(List=jitter.Values, Index="10")  # -> ListA, ListB
item_2 = ListItem(List=demesh.Vertices, Index=0, Wrap=True)
constant_time_series_3 = ConstantTimeSeriesAlpaca4d(LoadFactor=1)  # -> TimeSeries, Graph
end = EndPoints(Curve=split.ListA)  # -> Start, End
random_2 = Random(Range="20", Number=lng_2, Seed=2)
vec = VectorXYZ(XComponent=0, YComponent=0, ZComponent=random_2)  # -> Vector, Length
meshload = MeshLoadAlpaca4d(MeshElement=cull, Force=vec.Vector, TimeSeries=constant_time_series.TimeSeries)
X = UnitX(Factor=1)
point_load = PointLoadAlpaca4d(Point=item_2, Force=Z_2, Moment=Vector(0, 0, 0), TimeSeries=constant_time_series.TimeSeries)
data = Data(flatten(support))
Y = UnitY(Factor="1")
force_beam_column = ForceBeamColumnAlpaca4d(Line=split.ListA, Section=rectanglehollowcs)
Z_3 = UnitZ(Factor="1")
linearload = LinearLoadAlpaca4d(Force=X, TimeSeries=constant_time_series_2.TimeSeries)
list = ValueList({"Linear", "Newton", "NewtonLineSearch", "ModifiedNewton", "KrylovNewton", "SecantNewton", "BFGS", "Broyden"}, selected="Linear")
assemble_model = AssembleModelAlpaca4d(Element=flatten([asdq4, force_beam_column]), Support=data, Load=flatten(meshload), Tollerance=0.01)  # -> AlpacaModel, MassForce
point_load_2 = PointLoadAlpaca4d(Point=end.End, Force=Z_3, Moment=Vector(0, 0, 0), TimeSeries=constant_time_series_3.TimeSeries)
analysissettings = AnalysisSettingsAlpaca4d(Algorithm=list, AnalysisSteps="5")
ra = RunAnalysisAlpaca4d(AlpacaModel=assemble_model.AlpacaModel, Settings=analysissettings)  # -> Log, AlpacaModel
modelview = ModelViewAlpaca4d(
    AlpacaModel=ra.AlpacaModel,
    Extruded=Toggle(False),
    Load=Toggle(True),
    LoadFactor="0.1",
    Support=Toggle(True),
    SupportFactor=1,
    Constraint=False)  # -> AlpacaModel, Info
python = GhPythonScript(x=ra.AlpacaModel)  # -> out, a
# ---------- python: Python ----------
__author__ = "MarcoPellegrinoKonsu"
__version__ = "2022.08.07"

import rhinoscriptsyntax as rs

a = x.UniquePoints
# ---------- end python ----------
rf = ReactionForcesAlpaca4d(AlpacaModel=ra.AlpacaModel, History=False, Step=0)  # -> SupportPosition, ReactionForce, ReactionMoment
nd = NodalDisplacementsAlpaca4d(AlpacaModel=ra.AlpacaModel, History=False, Step=0)  # -> Displacement, Rotation, port, Velocity, Acceleration
vlen = VectorLength(Vector=nd.Displacement)
vdisex = VectorDisplayEx(Point=rf.SupportPosition, Vector=rf.ReactionForce, Colour=RGB(0, 0, 0), Width=2)
range = Range(Domain=Domain(0, 1), Steps=10)
number_slider = Slider(1.53, range=0..5)
number_slider_2 = Slider(1, range=1..100000)
panel_2 = Panel("1")
clr = ColorsAlpaca4d(GradientIndex=Slider(5, range=0..12))
bnd = Bounds(Numbers=vlen)
data_2 = Data(assemble_model.AlpacaModel)
panel_3 = Panel("0")
number_slider_3 = Slider(10, range=1..10)
modelview_2 = ModelViewAlpaca4d(
    AlpacaModel=data_2,
    Extruded=Toggle(False),
    Load=Toggle(False),
    LoadFactor=number_slider,
    Support=Toggle(True),
    SupportFactor=number_slider,
    Constraint=Slider(2.27, range=0..5))  # -> AlpacaModel, Info
dom = ConstructDomain(DomainStart="-10", DomainEnd="10")
range_2 = Range(Domain=Domain(0, 1), Steps=10)
c_script = CSharpScript(x=ra.AlpacaModel, y=number_slider_3, Reference="C:\GitHub\OpenSeesGh\Alpaca.Core\bin\Debug\Alpaca.Core.dll")  # -> out, A; inputs y: Double
# ---------- c_script: C# usings ----------
using Alpaca4d;
# ---------- c_script: C# ----------
    var model = (Alpaca4d.Model) x;

    var disp = model.DeformedBeam(1, y);
    A = disp;
# ---------- end c_script ----------
legend = Legend(Colour=clr, Tags=["One Fish", "Two Fish", "Red Fish", "Blue Fish"], LegendType=1)
deformed_model_view = DeformedModelViewAlpaca4d(AlpacaModel=ra.AlpacaModel, Step=Slider(4, range=0..4), Scale=number_slider_3)  # -> Line, Mesh, Brick
panel_4 = Panel(modelview_2.Info)
