# Grasshopper definition visualiseBeam.gh (Grasshopper 1.0.7)
# plug-ins: Alpaca4d, BH.UI.Grasshopper, MeshEdit Components

number_slider = Slider(1, range=1..20)
random = Random(Range=Domain(0, 1), Number=1, Seed=number_slider)
random_2 = Random(Range=Domain(0, 1), Number=1, Seed=number_slider)
random_3 = Random(Range=Domain(0, 1), Number=1, Seed=number_slider)
panel = Panel("0.50")
vec = VectorXYZ(XComponent=random, YComponent=random_2, ZComponent=random_3)  # -> Vector, Length
pt = Point(Point(0, 0, 0))
i_section = ISectionAlpaca4d(
    Height="0.60",
    TopFlangeWidth="0.60",
    TopFlangeThickness=0.02,
    BottomFlangeWidth=0.2,
    BottomFlangeThickness=0.02,
    Web=0.02)
rectanglehollowcs = RectangleHollowAlpaca4d(Width=0.3, Height=0.6, Web=0.02, TopFlange=0.02, BottomFlange=0.02)
circlecs = CircleCSAlpaca4d(Diameter=0.15, Thickness=0.01)
rectanglecs = RectangleCSAlpaca4d(Width=0.3, Height=0.6)
point = Point(Point(10, 10, 0))
line = LineSDL(Start=pt, Direction=Vector(0, 0, 1), Length="6")
point_2 = Point(Point(0, 10, 0))
rectangle = Rectangle(Plane=point, XSize=Domain(-1, 1), YSize=Domain(-2, 2), Radius=0)  # -> Rectangle, Length
rectangle_2 = Rectangle(Plane=point_2, XSize=Domain(-1, 1), YSize=Domain(-2, 2), Radius=0)  # -> Rectangle, Length
series = Series(Start=0, Step=1, Count=10)
merge = Merge(Data1=circlecs, Data2=rectanglecs, Data3=rectanglehollowcs, Data4=i_section)
mesh_plane = MeshPlane(Boundary=rectangle.Rectangle, WidthCount=10, HeightCount=10)  # -> Mesh, Area
lng = ListLength(List=merge)
unit_z = UnitZ(Factor=series)
point_3 = Point(Point(8, 0, 0))
series_2 = Series(Start=0, Step="2", Count=lng)
mesh_plane_2 = MeshPlane(Boundary=rectangle_2.Rectangle, WidthCount=10, HeightCount=10)  # -> Mesh, Area
move = Move(Geometry=mesh_plane.Mesh, Motion=unit_z)  # -> Geometry, Transform
X = UnitX(Factor=series_2)
mesh_sphere_ex = MeshSphereEx(Base=point_3, Radius="1", Count=5)
plate_fiber_section_alpaca4d = PlateFiberSectionAlpaca4d(Thickness="0.50")
move_2 = Move(Geometry=line, Motion=X)  # -> Geometry, Transform
lng_2 = ListLength(List=move_2.Geometry)
pframe = PerpFrame(Curve=reparameterize(move_2.Geometry), Parameter="0.50")
mesh_explode = MeshExplode(Mesh=mesh_plane_2.Mesh, Interpolate=False)
elastic_isotropic_material_alpaca4d = ElasticIsotropicMaterialAlpaca4d()
meshseriestobrick_alpaca4d = MeshSeriesToBrickAlpaca4d(Meshes=move.Geometry, Closed=False)
end = EndPoints(Curve=line)  # -> Start, End
random_4 = Random(Range="0.00 to 360", Number=lng_2, Seed=Slider(14, range=1..20))
rotate = Rotate(Geometry=pframe, Angle=degrees(random_4), Plane=pframe)  # -> Geometry, Transform
support = SupportAlpaca4d(Point=[end.Start, end.End], Tx=True, Ty=True, Tz=True, Rx=True, Ry=True, RZ=True)
asd_shellq4_alpaca4d = ASDShellQ4Alpaca4d(Mesh=mesh_explode, Section=plate_fiber_section_alpaca4d)
deplane = DeconstructPlane(Plane=rotate.Geometry)  # -> Origin, XAxis, YAxis, ZAxis
ssp_brick_alpaca4d = SSPBrickAlpaca4d(Mesh=meshseriestobrick_alpaca4d, Material=elastic_isotropic_material_alpaca4d)
swatch = ColourSwatch(SwatchColor=RGB(0, 0, 0))
force_beam_column = ForceBeamColumnAlpaca4d(Line=move_2.Geometry, Section=merge)
explode = Explode(Object=force_beam_column, Component="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")  # -> Curve, Section, GeomTransf, BeamIntegration, LocalZAxis, Type, Id, INode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
getproperty = GetProperty(Obj=explode.Section, PropName="Curves", Component="{ .GetProperty")
data = Data(flatten([asd_shellq4_alpaca4d, force_beam_column, ssp_brick_alpaca4d]))
item = ListItem(List=getproperty, Index=0, Wrap=True)
assemble_model = AssembleModelAlpaca4d(Element=data, Support=support, Tollerance=0.01)  # -> AlpacaModel, MassForce
topoly = CurveToPolyline(Curve=item, ToleranceDistance=0, ToleranceAngle=0)  # -> Polyline, Segments
model_view_alpaca4d = ModelViewAlpaca4d(
    AlpacaModel=assemble_model.AlpacaModel,
    Extruded=Toggle(True),
    Load=False,
    LoadFactor=1,
    Support=False,
    SupportFactor=1,
    Constraint=False)  # -> AlpacaModel, Info
x = Object(AlpacaModel=assemble_model.AlpacaModel)  # -> Beam, Shell, Brick
mesh = Mesh(x.Shell)
mesh_2 = Mesh(x.Brick)
mesh_3 = Mesh(x.Beam)
mesh_join = MeshJoin(Meshes=mesh)
mesh_join_2 = MeshJoin(Meshes=mesh_2)
mesh_join_3 = MeshJoin(Meshes=mesh_3)
mesh_4 = Mesh(mesh_join)
mesh_5 = Mesh(mesh_join_2)
mesh_6 = Mesh(mesh_join_3)
