# Grasshopper definition 3dModelDeformation.gh (Grasshopper 1.0.7)

crv = Curve([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])
swatch = ColourSwatch(SwatchColor=RGB(255, 255, 255))
swatch_2 = ColourSwatch(SwatchColor=RGB(0, 73, 209))
merge = Merge(Data1=ColourSwatch(SwatchColor=RGB(255, 255, 255)), Data2=ColourSwatch(SwatchColor=RGB(0, 73, 209)))
rev = ReverseList(List=merge)
filter = StreamFilter(Gate=Slider(1, range=0..1), Stream0=merge, Stream1=rev)
c_script = CSharpScript(iPolys=crv, iColors=filter)  # -> out, A; inputs iPolys: list of Polyline, iColors: list of Color
# ---------- c_script: C# usings ----------
using System.Drawing;
using System.Linq;
# ---------- c_script: C# ----------
    var a = CreateLoftOpen(iPolys, null, iColors);
    A = a;
# ---------- c_script: C# additional code ----------
  public static Mesh CreateLoftOpen(IList<Polyline> polylines, List<double> deformation = null, List<Color> iColors = null)
  {
    Mesh result = new Mesh();
    var verts = result.Vertices;
    var faces = result.Faces;
    var clrs = result.VertexColors;

    int ny = polylines.Count;
    int nx = Enumerable.Min(polylines, p => p.Count);
    int n;

    // add vertices
    for (int i = 0; i < ny; i++)
    {
      var poly = polylines[i];

      for (int j = 0; j < nx; j++)
      {
        verts.Add(poly[j]);
        clrs.Add(iColors[i]);
      }
    }

    // add faces
    for (int i = 0; i < ny - 1; i++)
    {
      n = i * nx;

      for (int j = 0; j < nx - 1; j++)
        faces.AddFace(n + j, n + j + 1, n + j + nx + 1, n + j + nx);
    }

    return result;
  }
# ---------- end c_script ----------
range = Range(Domain=Domain(0, 1), Steps=10)
panel = Panel("""-5.0
5.0""")
gradient = Gradient(LowerLimit=0, UpperLimit=1, Parameter=range, stops=[0: RGB(0, 0, 255), 0.5: RGB(255, 255, 255), 1: RGB(255, 0, 0)])
crv_2 = Curve(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)
crv_3 = Curve(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)
explode = Explode(Curve=crv_2, Recursive=True)  # -> Segments, Vertices
panel_2 = Panel("""0.00
1.00""")
c_script_2 = CSharpScript(
    iPolys=crv,
    iColors=gradient,
    deformed_value=panel,
    min="-5.0",
    max="5",
    Reference="C:\GitHub\Alpaca4d\Alpaca.Core\bin\Debug\Alpaca.Core.dll")  # -> out, A; inputs iPolys: list of Polyline, iColors: list of Color, deformed_value: list of Double, min: Double, max: Double
# ---------- c_script_2: C# usings ----------
using System.Drawing;
using System.Linq;
using Alpaca4d;
# ---------- c_script_2: C# ----------
    var a = CreateLoftClosed(iPolys, deformed_value, iColors, min, max);
    A = a;
# ---------- c_script_2: C# additional code ----------
  public static Mesh CreateLoftClosed(IList<Polyline> polylines, List<double> deformation, List<Color> iColors, double min, double max)
  {
    // find the total range of displacement

    var d = new SortedDictionary<double, System.Drawing.Color>();

    var numberOfColors = iColors.Count;
    var range = max - max;
    var diff = (max - min) / (numberOfColors - 1);

    var start = min;
    foreach (var color in iColors)
    {
      d.Add(start, color);
      start += diff;
    }


    Mesh result = new Mesh();
    var verts = result.Vertices;
    var faces = result.Faces;
    var clrs = result.VertexColors;

    int ny = polylines.Count;
    int nx = Enumerable.Min(polylines, p => p.Count) - 1;
    int n;

    // add vertices
    for (int i = 0; i < ny; i++)
    {
      var poly = polylines[i];

      for (int j = 0; j < nx; j++)
      {
        verts.Add(poly[j]);
        var clr = Alpaca4d.Colors.GetColor(deformation[i], d);
        clrs.Add(clr);
      }
    }

    // add faces
    for (int i = 0; i < ny - 1; i++)
    {
      n = i * nx;

      for (int j0 = 0; j0 < nx; j0++)
      {
        int j1 = (j0 + 1) % nx;
        faces.AddFace(n + j0, n + j1, n + j1 + nx, n + j0 + nx);
      }
    }

    return result;
  }
# ---------- end c_script_2 ----------
graft = GraftTree(Tree=explode.Segments, IncludeEmptyLists=True, IncludeNullItems=True)
pframe = PerpFrame(Curve=reparameterize(graft), Parameter=panel_2)
orient = Orient(Geometry=crv_3, Source=PlaneXY(0, 0, 0), Target=pframe)  # -> Geometry, Transform
panel_3 = Panel("""20
-5""")
panel_4 = Panel("""10
20""")
panel_5 = Panel("""1
10""")
range_2 = Range(Domain=Domain(0, 1), Steps=10)
gradient_2 = Gradient(LowerLimit=0, UpperLimit=1, Parameter=range_2, stops=[0: RGB(0, 0, 255), 0.5: RGB(255, 255, 255), 1: RGB(255, 0, 0)])
entwine = Entwine(Branch00=panel_5, Branch01=panel_4, Branch02=panel_3, FlattenInputs=True)
graft_2 = GraftTree(IncludeEmptyLists=True, IncludeNullItems=True)
c_script_3 = CSharpScript(
    iPolys=orient.Geometry,
    iColors=gradient_2,
    deformed_value=entwine,
    min="-10",
    max="20",
    Reference="C:\GitHub\Alpaca4d\Alpaca.Core\bin\Debug\Alpaca.Core.dll")  # -> out, A; inputs iPolys: list of Polyline, iColors: list of Color, deformed_value: list of Double, min: Double, max: Double; same code as c_script_2
