# Grasshopper definition Beam.gh (Grasshopper 1.0.7)
# plug-ins: Alpaca4d, BH.UI.Grasshopper

yz = YZPlane(Origin=Point(0, 0, 0))
xy = XYPlane(Origin=Point(0, 0, 0))
rectangle = Rectangle(Plane=yz, XSize="-5 to 5", YSize="-5 to 5", Radius=0)  # -> Rectangle, Length
mplane = MeshPlane(Boundary=rectangle.Rectangle, WidthCount="2", HeightCount="2")  # -> Mesh, Area
series = Series(Start=0, Step="10", Count="12")
X = UnitX(Factor=series)
move = Move(Geometry=mplane.Mesh, Motion=X)  # -> Geometry, Transform
item = ListItem(List=move.Geometry, Index=0, Wrap=True)  # -> Item1, Item, Item1_2
demesh = DeconstructMesh(Mesh=item.Item1)  # -> Vertices, Faces, Colours, Normals
demesh_2 = DeconstructMesh(Mesh=item.Item)  # -> Vertices, Faces, Colours, Normals
circlecs = CircleCSAlpaca4d()
mstb = MeshSeriesToBrickAlpaca4d(Meshes=move.Geometry, Closed=Toggle(False))
eim = ElasticIsotropicMaterialAlpaca4d()
item_2 = ListItem(List=move.Geometry, Index="-1", Wrap=True)
constant_time_series = ConstantTimeSeriesAlpaca4d(LoadFactor=1)  # -> TimeSeries, Graph
demesh_3 = DeconstructMesh(Mesh=item_2)  # -> Vertices, Faces, Colours, Normals
Z = UnitZ(Factor=1)
X_2 = UnitX(Factor=1)
ssp = SSPBrickAlpaca4d(Mesh=mstb, Material=eim)
support = SupportAlpaca4d(Point=demesh_2.Vertices, Tx=True, Ty=True, Tz=True, Rx=True, Ry=True, RZ=True)
point_load = PointLoadAlpaca4d(Point=demesh.Vertices, Force=Z, Moment=Vector(0, 0, 0), TimeSeries=constant_time_series.TimeSeries)
line = LineSDL(Start=demesh_3.Vertices, Direction=X_2, Length="5")
force_beam_column = ForceBeamColumnAlpaca4d(Line=line, Section=circlecs)
panel = Panel("""BandGen
BandSPD
ProfileSPD
SuperLU
UmfPack
FullGeneral
SparseSYM""")
assemble_model = AssembleModelAlpaca4d(Element=flatten(ssp), Support=support, Load=point_load, Tollerance=0.01)  # -> AlpacaModel, Tcl
panel_2 = Panel("BandGen")
panel_3 = Panel("Linear")
item_3 = ListItem(List=panel, Index="2", Wrap=True)
analysissettings = AnalysisSettingsAlpaca4d(System=item_3)
python = GhPythonScript(x=assemble_model.AlpacaModel)  # -> out, a, b
# ---------- python: Python ----------
__author__ = "MarcoPellegrinoKonsu"
__version__ = "2022.07.30"

import rhinoscriptsyntax as rs

a =  x.UniquePointsSixNDF
b = x.UniquePointsThreeNDF
# ---------- end python ----------
threendf = Geometry(python.b)
sixndf = Geometry(python.a)
explode = Explode(Object=analysissettings, Component="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")  # -> Constraint, Numberer, SystemEquation, Test, Algorithm, Integrator, Analysis, AnalysisStep, Damping
ra = RunAnalysisAlpaca4d(AlpacaModel=assemble_model.AlpacaModel, Settings=analysissettings)  # -> Log, AlpacaModel
panel_4 = Panel(ra.Log)
explode_2 = Explode(Object=explode.Algorithm, Component="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")
rf = ReactionForcesAlpaca4d(AlpacaModel=ra.AlpacaModel, History=False, Step=0)  # -> SupportPosition, ReactionForce, ReactionMoment
nd = NodalDisplacementsAlpaca4d(AlpacaModel=ra.AlpacaModel, History=False, Step=0)  # -> Displacement, Rotation, port, Velocity, Acceleration
python_2 = GhPythonScript(x=ra.AlpacaModel)  # -> out, a
# ---------- python_2: Python ----------
__author__ = "MarcoPellegrinoKonsu"
__version__ = "2022.07.29"

import rhinoscriptsyntax as rs

a = x.UniquePoints
# ---------- end python_2 ----------
number_slider = Slider(0, range=0..2)
multiplication = Multiplication(A=nd.Displacement, B="5e9")
vdisex = VectorDisplayEx(Point=rf.SupportPosition, Vector=rf.ReactionForce, Colour=RGB(0, 0, 0), Width=2)
move_2 = Move(Geometry=python_2.a, Motion=multiplication)  # -> Geometry, Transform
