# Grasshopper definition CantiliverBeamConcentratedLoad.gh (Grasshopper 1.0.7)
# plug-ins: Alpaca4d, BH.UI.Grasshopper

steel01 = Steel01Alpaca4d()
i_section = ISectionAlpaca4d(Height=0.3, TopFlangeWidth=0.15, TopFlangeThickness=0.02, BottomFlangeWidth=0.2, BottomFlangeThickness=0.02, Web=0.02)
rectanglehollowcs = RectangleHollowAlpaca4d(Width=0.3, Height=0.6, Web=0.02, TopFlange=0.02, BottomFlange=0.02, Material=steel01)
circlecs = CircleCSAlpaca4d(Diameter=0.15, Thickness=0.01)
rectanglecs = RectangleCSAlpaca4d(Width=0.3, Height=0.6)
X = UnitX(Factor=1)
pt = Point(Point(0, 0, 0))
list = ValueList({"ipe": 0, "rect": 1, "hollowSquare": 2, "circle": 3}, selected="hollowSquare")
line = LineSDL(Start=pt, Direction=X, Length="12")
filter = StreamFilter(Gate=list, Stream0=i_section, Stream1=rectanglecs, Stream2=rectanglehollowcs, Stream3=circlecs)
python = GhPythonScript()  # -> Out, A
vec = VectorXYZ(XComponent=Slider(0.2, range=0..1), YComponent=Slider(0.22, range=0..1), ZComponent=Slider(1, range=0..1))  # -> Vector, Length
Y = UnitY(Factor=1)
Z = UnitZ(Factor=1)
end = EndPoints(Curve=line)  # -> Start, End
Z_2 = UnitZ(Factor="1000000")
panel = Panel("""30000
30000
30000""")
force_beam_column = ForceBeamColumnAlpaca4d(Line=line, Section=filter, ZAxis=Y)
constant_time_series = ConstantTimeSeriesAlpaca4d(LoadFactor=1)  # -> TimeSeries, Graph
support = SupportAlpaca4d(Point=end.Start, Tx=True, Ty=True, Tz=True, Rx=True, Ry=True, RZ=True)
Z_3 = UnitZ(Factor=panel)
getproperty = GetProperty(Obj=force_beam_column, PropName="Curve", Component="{ .GetProperty")
getproperty_2 = GetProperty(Obj=force_beam_column, PropName="Section", Component="{ .GetProperty")
linearload = LinearLoadAlpaca4d(Force=Z_3, TimeSeries=constant_time_series.TimeSeries)
assemble_model = AssembleModelAlpaca4d(Element=force_beam_column, Support=support, Load=flatten(linearload), Tollerance=0.01)  # -> AlpacaModel, MassForce
analysissettings = AnalysisSettingsAlpaca4d()
vlen = VectorLength(Vector=Z_2)
panel_2 = Panel(linearload)
explode = Explode(Component="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")
getproperty_3 = GetProperty(Obj=getproperty_2, PropName="Material", Component="{ .GetProperty")
getproperty_4 = GetProperty(Obj=getproperty_2, PropName="Iyy", Component="{ .GetProperty")
getproperty_5 = GetProperty(Obj=getproperty_2, PropName="Izz", Component="{ .GetProperty")
len = Length(Curve=getproperty)
num = Number(vlen)
ra = RunAnalysisAlpaca4d(AlpacaModel=assemble_model.AlpacaModel, Settings=analysissettings)  # -> Log, AlpacaModel
panel_3 = Panel(getproperty_4)
getproperty_6 = GetProperty(Obj=getproperty_3, PropName="E", Component="{ .GetProperty")
bang = ExplodeTree(Data=getproperty_5)  # -> Branch0, Branch1
getproperty_7 = GetProperty(Obj=force_beam_column, PropName="Section", Component="{ .GetProperty")
getproperty_8 = GetProperty(Obj=force_beam_column, PropName="GeomTransf", Component="{ .GetProperty")
python_2 = GhPythonScript(P=num, L=len, E=getproperty_6, I=bang.Branch0)  # -> out, a
# ---------- python_2: Python ----------
__author__ = "MarcoPellegrinoKonsu"
__version__ = "2022.09.09"

import rhinoscriptsyntax as rs

a = P * L**3/(3*E*I)
# ---------- end python_2 ----------
panel_4 = Panel(bang.Branch0)
nd = NodalDisplacementsAlpaca4d(AlpacaModel=ra.AlpacaModel, History=False, Step=0)  # -> Displacement, Rotation, port, Velocity, Acceleration
panel_5 = Panel(nd.Displacement)
panel_6 = Panel(python_2.a)
getproperty_9 = GetProperty(Obj=getproperty_7, PropName="Curves", Component="{ .GetProperty")
panel_7 = Panel(nd.Displacement)
explode_2 = Explode(Object=getproperty_8, Component="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")  # -> Type, Line, Id, LocalZ, LocalY
bang_2 = ExplodeTree(Data=panel_6)  # -> Branch0, Branch1
list_item = ListItem(List=getproperty_9, Index=0, Wrap=True)
number_slider = Slider(0.001, range=0.001..5)
item = ListItem(List=panel_7, Index="1", Wrap=True)
panel_8 = Panel(explode_2.LocalZ)
panel_9 = Panel(explode_2.LocalY)
merge = Merge(Data2=flatten(item))
end_2 = EndPoints(Curve=explode_2.Line)  # -> Start, End
data = Data(flatten(bang_2.Branch0))
midpt = CurveMiddle(Curve=explode_2.Line)
data_2 = Data(flatten(merge))
modelview = ModelViewAlpaca4d(Extruded=False, Load=Toggle(True), LoadFactor="0.00001", Support=Toggle(True), SupportFactor=1, Constraint=False)  # -> AlpacaModel, Info
pl = ConstructPlane(Origin=[end_2.Start, end_2.End], XAxis=explode_2.LocalZ, YAxis=explode_2.LocalY)
deformed_model_view_alpaca4d = DeformedModelViewAlpaca4d(AlpacaModel=ra.AlpacaModel, Step=0, Scale=1)  # -> Line, Mesh, Brick
panel_10 = Panel(data_2)
panel_11 = Panel(data)
orient = Orient(Geometry=list_item, Source=PlaneXY(0, 0, 0), Target=pl)  # -> Geometry, Transform
vdisex = VectorDisplayEx(Point=midpt, Vector=panel_9, Colour=ColourSwatch(SwatchColor=RGB(48, 204, 0)), Width="3")
vdisex_2 = VectorDisplayEx(Point=midpt, Vector=panel_8, Colour=ColourSwatch(SwatchColor=RGB(0, 118, 161)), Width="3")
pdecon = Deconstruct(Point=panel_10)  # -> XComponent, YComponent, ZComponent
panel_12 = Panel(modelview.Info)
similar = Similarity(FirstNumber=pdecon.ZComponent, SecondNumber=panel_11, Threshold="3")  # -> Similarity, AbsoluteDifference
ml = MeshLoftAlpaca4d(Polylines=orient.Geometry)
merge_2 = Merge(Data1=ColourSwatch(SwatchColor=RGB(255, 0, 0)), Data2=ColourSwatch(SwatchColor=RGB(77, 255, 0)))
item_2 = ListItem(List=merge_2, Index=similar.Similarity, Wrap=True)
preview = CustomPreview(Geometry=ml, Material=ColourSwatch(SwatchColor=RGBA(255, 255, 255, 112)))
legend = Legend(Colour=item_2, Tags=similar.Similarity, LegendType=1)
