# Grasshopper definition natural_frequency.gh (Grasshopper 1.0.7)
# plug-ins: Alpaca4d, BH.UI.Grasshopper

Z = UnitZ(Factor=1)
pt = Point(Point(0, 0, 0))
Z_2 = UnitZ(Factor=1)
pt_2 = Point(Point(0, 0, 0))
line = LineSDL(Start=pt, Direction=Z, Length="10")
line_2 = LineSDL(Start=pt_2, Direction=Z_2, Length="10")
uniaxial_material_elastic = UniaxialMaterialElasticAlpaca4d(E="2.1e11", Rho="0.00")
uniaxial_material_elastic_2 = UniaxialMaterialElasticAlpaca4d(E="2.1e11")
end = EndPoints(Curve=line)  # -> Start, End
end_2 = EndPoints(Curve=line_2)  # -> Start, End
divide = DivideCurve(Curve=line_2, Count="20", Kinks=False)  # -> Points, Tangents, Parameters
pline = PolyLine(Vertices=divide.Points, Closed=False)
rectanglecs = RectangleCSAlpaca4d(Width=0.3, Height=0.6, Material=uniaxial_material_elastic)
circlecs = CircleCSAlpaca4d(Diameter=0.15, Thickness=0.01, Material=uniaxial_material_elastic_2)
explode = Explode(Curve=pline, Recursive=True)  # -> Segments, Vertices
crv = Curve(line)
crv_2 = Curve(explode.Segments)
vec = VectorXYZ(XComponent="2000", YComponent="2000", ZComponent="2000")  # -> Vector, Length
force_beam_column = ForceBeamColumnAlpaca4d(Line=crv, Section=rectanglecs)
mp = MassPointAlpaca4d(Point=end.End, TransMass=vec.Vector, RotationalMass=Vector(0, 0, 0))
support = SupportAlpaca4d(Point=end.Start, Tx=True, Ty=True, Tz=True, Rx=True, Ry=True, RZ=True)
support_2 = SupportAlpaca4d(Point=end_2.Start, Tx=True, Ty=True, Tz=True, Rx=True, Ry=True, RZ=True)
force_beam_column_2 = ForceBeamColumnAlpaca4d(Line=crv_2, Section=circlecs)
explode_2 = Explode(Object=circlecs, Component="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")  # -> Id, Material, SectionName, Diameter, Thickness, Area, AlphaY, AlphaZ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
assemble_model = AssembleModelAlpaca4d(Element=force_beam_column, Support=support, Load=mp, Tollerance=0.01)  # -> AlpacaModel, MassForce
assemble_model_2 = AssembleModelAlpaca4d(Element=force_beam_column_2, Support=support_2, Tollerance=0.01)  # -> AlpacaModel, MassForce
item = ListItem(List=force_beam_column_2, Index=0, Wrap=True)
explode_3 = Explode(Object=rectanglecs, Component="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")  # -> Id, Material, SectionName, Width, Height, Area, AlphaY, AlphaZ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
list = ValueList({"-genBandArpack", "-symmBandLapack", "-fullGenLapack"}, selected="-fullGenLapack")
explode_4 = Explode(Object=item, Component="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")  # -> Curve, Section, GeomTransf, BeamIntegration, LocalZAxis, Type, Id, INode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
list_2 = ValueList({"-genBandArpack", "-symmBandLapack", "-fullGenLapack"}, selected="-fullGenLapack")
python = GhPythonScript(E="2.1e11", I=[explode_3.Iyy, explode_3.Izz], mass="2000", length="10")  # -> out, f
# ---------- python: Python ----------
__author__ = "Marco"
__version__ = "2022.11.17"

import rhinoscriptsyntax as rs
import math
f = 1 / (2 * math.pi) * math.sqrt( (3 * E * I ) / (mass * length ** 3) )
# ---------- end python ----------
nv = NaturalVibrationAnalysisAlpaca4d(AlpacaModel=assemble_model.AlpacaModel, VibrationModes="2", Solver=list)  # -> Log, AlpacaModel, Eigenvalues, Period, Frequencies
python_2 = GhPythonScript(E="2.1e11", I=[explode_2.Iyy, explode_2.Izz], mass=explode_4.MassDens, length="10")  # -> out, f1, f2, f3
# ---------- python_2: Python ----------
__author__ = "Marco"
__version__ = "2022.11.17"

import rhinoscriptsyntax as rs
import math
const = math.sqrt( (E * I ) / (mass * length ** 4) )  / (2 * math.pi)
f1 = 1.875 ** 2 * const
f2 = 4.694 ** 2 * const
f3 = 7.855 ** 2 * const
# ---------- end python_2 ----------
nv_2 = NaturalVibrationAnalysisAlpaca4d(AlpacaModel=assemble_model_2.AlpacaModel, VibrationModes="12", Solver=list_2)  # -> Log, AlpacaModel, Eigenvalues, Period, Frequencies
panel = Panel(python.f)
panel_2 = Panel(python_2.f1)
panel_3 = Panel(python_2.f2)
panel_4 = Panel(python_2.f3)
panel_5 = Panel(nv.Frequencies)
panel_6 = Panel(nv_2.Frequencies)
deformed_model_view = DeformedModelViewAlpaca4d(AlpacaModel=nv_2.AlpacaModel, Step=Slider(0, range=0..3), Scale=Slider(620, range=1..1000))  # -> Line, Mesh, Brick
