# Grasshopper definition portal_frame.gh (Grasshopper 1.0.7)
# plug-ins: Karamba3D, Alpaca4d, BH.UI.Grasshopper, Kangaroo2 Components, MeshEdit Components

cross_section = CrossSectionKaramba3D(
    FamilyNameOfCrossSection="DefaultCroSec",
    Height_cm=9.6,
    UpperFlangeWidth_cm=10,
    LowerFlangeWidth_cm=10,
    UpperFlangeThickness_cm=0.8,
    LowerFlangeThickness_cm=0.8,
    WebThickness_cm=0.5,
    FilletRadius_cm=0,
    mode="I")
crv = Curve([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])
item = ListItem(List=crv, Index=0, Wrap=True)  # -> Item, Item1
cross_section_2 = CrossSectionKaramba3D(FamilyNameOfCrossSection="DefaultCroSec", Diameter_cm=11.43, WallThickness_cm=0.4, mode="Circular Hollow")
panel = Panel("""0
0.25
0.5
0.75
1.0""")
range = Range(Domain=Domain(0, 1), Steps="2")
tweencrv = TweenCurve(CurveA=item.Item, CurveB=item.Item1, Factor=range, BlendType=0)
divide = DivideCurve(Curve=tweencrv, Count=10, Kinks=False)  # -> Points, Tangents, Parameters
crv_2 = Curve([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])
pt = Point([Point(27, 0, 0), Point(0, 0, 0), Point(0, 13, 0), Point(27, 13, 0)])
pline = PolyLine(Vertices=divide.Points, Closed=False)
refine = Refine(Level=1)
cross_section_3 = CrossSectionKaramba3D(FamilyNameOfCrossSection="DefaultCroSec", Height_cm="5", mode="Shell - Const")
explode = Explode(Curve=crv_2, Recursive=True)  # -> Segments, Vertices
vec = VectorXYZ(XComponent="10", YComponent=0, ZComponent=0)  # -> Vector, Length
pt_2 = Point([Point(3, 0, 9), Point(3, 13, 9)])
ml = MeshLoftAlpaca4d(Polylines=flatten(pline))
divide_2 = DivideCurve(Curve=explode.Segments, Count=10, Kinks=False)  # -> Points, Tangents, Parameters
pline_2 = PolyLine(Vertices=divide_2.Points, Closed=False)
supp = SupportKaramba3D(PosInd=pt, menu=[buttons(on, on, on, on, on, on)])
explode_2 = Explode(Curve=pline_2, Recursive=True)  # -> Segments, Vertices
linetobeam = LineToBeamKaramba3D(
    Line=explode_2.Segments,
    CrossSection=cross_section,
    New=True,
    Remove=True,
    LimitDistance_m=0.005,
    Bending=True,
    SetBucklingLength=True,
    ToPolylineMaxAngle=0.03,
    ToPolylineTolerance=0.01,
    ToPolylineMaxEdgeLength=0.25)  # -> Element, Points, Info
loads = LoadsKaramba3D(ForceVector=vec.Vector, Local=False, PosInd=pt_2, LCase="LoadCase1", mode="Point")
meshtoshell = MeshToShellKaramba3D(Mesh=ml, CrossSection=cross_section_3, LimitDistance_m=0.005)  # -> Element, Points, Info
assemble = AssembleModelKaramba3D(Elem=flatten([linetobeam.Element, meshtoshell.Element]), Support=supp, Load=loads, LimitDistance_m=0.005)  # -> Model, Info, Mass_kg, CenterOfGravity, LoadCaseNames
analyze = AnalyzeKaramba3D(Model=assemble.Model)  # -> CalculatedModel, MaximumDisplacement_cm, ResultingForceOfGravity_kN, ElasticEnergyChange_kNm
modelview = ModelViewKaramba3D(Model=analyze.CalculatedModel, ResultFactors=1, ResultCase=-1)  # -> Model, DeformedMesh, DeformedAxes, DeformedModel
panel_2 = Panel(analyze.MaximumDisplacement_cm)
nodedisp = NodalDisplacementsKaramba3D(AnalyzedModel=analyze.CalculatedModel)  # -> AnalyzedModel, NodalTranslations_m, NodalRotations_rad
disassemble = DisassembleModelKaramba3D(Model=analyze.CalculatedModel)  # -> Model, Point, Beam, Shell, Support, Load, Line, Mesh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
disassemble_2 = DisassembleElementKaramba3D(Element=disassemble.Beam)  # -> Element, ElementIdentifier, AxisOfElement, CrossSection, Joint, Material, LocalCoordinateSystem, ElementIsActive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
disassemble_3 = DisassembleCrossSectionKaramba3D(CroSec=disassemble_2.CrossSection)  # -> CrossSection, FamilyNameOfCrossSection, TypeNameOfCrossSection, ElemIdentifiers, Color, Material, LocalEccentricity_cm, Heights_cm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
item_2 = ListItem(List=disassemble_3.Material, Index=0, Wrap=True)
disassemble_4 = DisassembleMaterialKaramba3D(Material=item_2)  # -> Material, TypeOfMaterial, FamilyNameOfMaterial, NameOfMaterial, ElemIdentifiers, Color, YoungsModulusKNCm2Dir12, InPlaneShearModulus_kN_cm2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
num = Number(expr("x/100000000", disassemble_3.Izz_cm4))
num_2 = Number(expr("x/100000000", disassemble_3.Ipp_cm4))
num_3 = Number(expr("x/10000", disassemble_3.Area_cm2))
num_4 = Number(expr("x/10000", disassemble_3.AreaY_cm2))
num_5 = Number(expr("x/10000", disassemble_3.AreaZ_cm2))
num_6 = Number(expr("x/100000000", disassemble_3.Iyy_cm4))
disassemble_5 = DisassembleElementKaramba3D(Element=disassemble.Shell)  # -> Element, ElementIdentifier, AxisOfElement, CrossSection, Joint, Material, LocalCoordinateSystem, ElementIsActive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
disassemble_6 = DisassembleCrossSectionKaramba3D(CroSec=disassemble_5.CrossSection)  # -> CrossSection, FamilyNameOfCrossSection, TypeNameOfCrossSection, ElemIdentifiers, Color, Material, LocalEccentricity_cm, Heights_cm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
disassemble_7 = DisassembleMaterialKaramba3D(Material=disassemble_5.Material)  # -> Material, TypeOfMaterial, FamilyNameOfMaterial, NameOfMaterial, ElemIdentifiers, Color, YoungsModulusKNCm2Dir12, InPlaneShearModulus_kN_cm2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
multiplication = Multiplication(A=disassemble_4.InPlaneShearModulus_kN_cm2, B="1e+7")
multiplication_2 = Multiplication(A=disassemble_4.YoungsModulusKNCm2Dir12, B="1e+7")
panel_3 = Panel("121212121")
uniaxial_material_elastic = UniaxialMaterialElasticAlpaca4d(E=multiplication_2, G=multiplication, Rho=disassemble_4.SpecificWeight_kN_m3)
division = Division(A=num_4, B=num_3)
division_2 = Division(A=num_5, B=num_3)
data = Data(num)
division_3 = Division(A=disassemble_6.Heights_cm, B="100")
multiplication_3 = Multiplication(A=disassemble_7.YoungsModulusKNCm2Dir12, B="1e+7")
multiplication_4 = Multiplication(A=disassemble_7.TransverseShearModulusKNCm2Dir12, B="1e+7")
generic_section = GenericSectionAlpaca4d(Area=num_3, Izz=num_6, Iyy=data, J=num_2, AlphaY=division, AlphaZ=division_2, Material=uniaxial_material_elastic)
eim = ElasticIsotropicMaterialAlpaca4d(E=multiplication_3, G=multiplication_4, Rho=disassemble_7.SpecificWeight_kN_m3)
constant_time_series = ConstantTimeSeriesAlpaca4d(LoadFactor=1)  # -> TimeSeries, Graph
multiplication_5 = Multiplication(A=vec.Vector, B="1000")
pfs = PlateFiberSectionAlpaca4d(Thickness=division_3, Material=eim)
force_beam_column = ForceBeamColumnAlpaca4d(Line=disassemble_2.AxisOfElement, Section=generic_section)
explode_3 = MeshExplode(Mesh=ml, Interpolate=False)
support = SupportAlpaca4d(Point=pt, Tx=True, Ty=True, Tz=True, Rx=True, Ry=True, RZ=True)
point_load = PointLoadAlpaca4d(Point=pt_2, Force=multiplication_5, Moment=Vector(0, 0, 0), TimeSeries=constant_time_series.TimeSeries)
explode_4 = Explode(Object=generic_section, Component="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")  # -> SectionName, Area, Izz, Iyy, J, AlphaY, AlphaZ, Id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
asdq4 = ASDShellQ4Alpaca4d(Mesh=explode_3, Section=pfs)
assemble_model = AssembleModelAlpaca4d(Element=flatten([force_beam_column, asdq4]), Support=support, Load=point_load, Tollerance=0.01)  # -> AlpacaModel, MassForce
list = ValueList({"Linear", "Newton", "NewtonLineSearch", "ModifiedNewton", "KrylovNewton", "SecantNewton", "BFGS", "Broyden"}, selected="Linear")
analysissettings = AnalysisSettingsAlpaca4d(Algorithm=list)
ra = RunAnalysisAlpaca4d(AlpacaModel=assemble_model.AlpacaModel, Settings=analysissettings)  # -> Log, AlpacaModel
modelview_2 = ModelViewAlpaca4d(
    AlpacaModel=assemble_model.AlpacaModel,
    Extruded=Toggle(False),
    Load=Toggle(True),
    LoadFactor="0.001",
    Support=Toggle(True),
    SupportFactor=1,
    Constraint=False)  # -> AlpacaModel, Info
nd = NodalDisplacementsAlpaca4d(AlpacaModel=ra.AlpacaModel, History=False, Step=0)  # -> Displacement, Rotation, port, Velocity, Acceleration
nodedisp_2 = NodalDisplacementsKaramba3D(AnalyzedModel=analyze.CalculatedModel)  # -> AnalyzedModel, NodalTranslations_m, NodalRotations_rad; disabled
clr = ColorsAlpaca4d(GradientIndex=11)  # -> reverse(Colors)
vlen = VectorLength(Vector=nd.Displacement)
deformed_model_view = DeformedModelViewAlpaca4d(AlpacaModel=ra.AlpacaModel, Step=0, Scale=Slider(1, range=1..10), Colors=clr)  # -> Line, Mesh, Brick
bnd = Bounds(Numbers=vlen)
panel_5 = Panel(bnd)
devec = DeconstructVector(Vector=nodedisp_2.NodalTranslations_m)  # -> XComponent, YComponent, ZComponent; disabled
devec_2 = DeconstructVector(Vector=nd.Displacement)  # -> XComponent, YComponent, ZComponent; disabled
panel_7 = Panel("5")  # disabled
similar = Similarity(FirstNumber=devec.XComponent, SecondNumber=devec_2.XComponent, Threshold=panel_7)  # -> Similarity, AbsoluteDifference; disabled
similar_2 = Similarity(FirstNumber=devec.YComponent, SecondNumber=devec_2.YComponent, Threshold=panel_7)  # -> Similarity, AbsoluteDifference; disabled
similar_3 = Similarity(FirstNumber=devec.ZComponent, SecondNumber=devec_2.ZComponent, Threshold=panel_7)  # -> Similarity, AbsoluteDifference; disabled
swatch = ColourSwatch(SwatchColor=RGB(255, 0, 0))  # disabled
swatch_2 = ColourSwatch(SwatchColor=RGB(77, 255, 0))  # disabled
entwine = Entwine(Branch00=similar.Similarity, Branch01=similar_2.Similarity, Branch02=similar_3.Similarity, FlattenInputs=True)  # -> flatten(Result); disabled
merge = Merge(Data1=swatch, Data2=swatch_2)  # disabled
item_3 = ListItem(List=merge, Index=entwine, Wrap=True)  # disabled
legend = Legend(Colour=item_3, Tags=entwine, LegendType=1)  # disabled
