# Grasshopper definition shell.gh (Grasshopper 1.0.7)
# plug-ins: Alpaca4d, Kangaroo2 Components, Weaverbird

eim = ElasticIsotropicMaterialAlpaca4d(E=" 2.03E+11", V="0.30", Rho="7.7E+03")
rectangle = Rectangle(Plane=PlaneXY(0, 0, 0), XSize="0.608", YSize="0.608", Radius=0)  # -> Rectangle, Length
mplane = MeshPlane(Boundary=rectangle.Rectangle, WidthCount="20", HeightCount="20")  # -> Mesh, Area
pfs = PlateFiberSectionAlpaca4d(Thickness="0.0254", Material=eim)
wbnaked = WeaverbirdsNakedBoundary(MeshClosedPolylines=mplane.Mesh)
splitatcorners = SplitAtCorners(Poly=wbnaked, Angle=1)  # -> Corners, Parts
item = ListItem(List=splitatcorners.Parts, Index=0, Wrap=True)
explode = Explode(Curve=item, Recursive=True)  # -> Segments, Vertices
asdq4_dkgt = ASDShellQ4Alpaca4d(Mesh=mplane.Mesh, Section=pfs)
mc = MeshCorners(Mesh=mplane.Mesh, Angle=2.35619449)
gravity_load = GravityLoadAlpaca4d(TimeSeriesType="Constant", GFactor=9.81)
support = SupportAlpaca4d(Point=explode.Vertices, Tx=True, Ty=True, Tz=True, Rx=True, Ry=True, RZ=True)
panel = Panel(asdq4_dkgt)
assemble_model = AssembleModelAlpaca4d(Element=flatten(asdq4_dkgt), Support=flatten(support), Load=flatten(gravity_load), Tollerance=0.01)  # -> AlpacaModel, MassForce
list = ValueList({"-genBandArpack", "-symmBandLapack", "-fullGenLapack"}, selected="-genBandArpack")
nv = NaturalVibrationAnalysisAlpaca4d(AlpacaModel=assemble_model.AlpacaModel, VibrationModes="3", Solver=list)  # -> Log, AlpacaModel, Eigenvalues, Period, Frequencies
theoretical_solution = Panel("""0.0179
0.00732
0.00292""")
panel_2 = Panel(nv.Period)
python = GhPythonScript(x=theoretical_solution, y=panel_2)  # -> out, diff
# ---------- python: Python ----------
__author__ = "Marco"
__version__ = "2023.04.10"

import rhinoscriptsyntax as rs

diff = (x - y) / x
diff = "{:.1%}".format(diff)
# ---------- end python ----------
deformed_model_view = DeformedModelViewAlpaca4d(AlpacaModel=nv.AlpacaModel, Step=0, Scale=1)  # -> Line, Mesh, Brick
panel_3 = Panel(python.diff)
