# Grasshopper definition simpli_supported_beam.gh (Grasshopper 1.0.7)
# plug-ins: Alpaca4d, BH.UI.Grasshopper

uniaxial_material_elastic = UniaxialMaterialElasticAlpaca4d()
i_section = ISectionAlpaca4d(
    Height=0.3,
    TopFlangeWidth=0.15,
    TopFlangeThickness=0.02,
    BottomFlangeWidth=0.2,
    BottomFlangeThickness=0.02,
    Web=0.02,
    Material=uniaxial_material_elastic)
rectanglehollowcs = RectangleHollowAlpaca4d(Width=0.3, Height=0.6, Web=0.02, TopFlange=0.02, BottomFlange=0.02, Material=uniaxial_material_elastic)
circlecs = CircleCSAlpaca4d(Diameter=0.15, Thickness=0.01, Material=uniaxial_material_elastic)
rectanglecs = RectangleCSAlpaca4d(Width=0.3, Height=0.6, Material=uniaxial_material_elastic)
list = ValueList({"ipe": 0, "rect": 1, "hollowSquare": 2, "circle": 3}, selected="rect")
X = UnitX(Factor=1)
pt = Point(Point(0, 0, 0))
line = LineSDL(Start=pt, Direction=X, Length="12")
divide = DivideCurve(Curve=line, Count="30", Kinks=False)  # -> Points, Tangents, Parameters
filter = StreamFilter(Gate=list, Stream0=i_section, Stream1=rectanglecs, Stream2=rectanglehollowcs, Stream3=circlecs)
pline = PolyLine(Vertices=divide.Points, Closed=False)
explode = Explode(Curve=pline, Recursive=True)  # -> Segments, Vertices
Z = UnitZ(Factor=1)
Y = UnitY(Factor=1)
vec = VectorXYZ(XComponent=Slider(0.2, range=0..1), YComponent=Slider(0.22, range=0..1), ZComponent=Slider(1, range=0..1))  # -> Vector, Length
force_beam_column = ForceBeamColumnAlpaca4d(Line=explode.Segments, Section=filter, ZAxis=Z)
item = ListItem(List=force_beam_column, Index=0, Wrap=True)
end = EndPoints(Curve=line)  # -> Start, End
gfactor = GFactor(9.81)
getproperty = GetProperty(Obj=item, PropName="MassDens", Component="{ .GetProperty")
getproperty_2 = GetProperty(Obj=item, PropName="Section", Component="{ .GetProperty")
boolean_toggle = BooleanToggle(True)
gravity_load = GravityLoadAlpaca4d(TimeSeriesType="Constant", GFactor=gfactor)
support = SupportAlpaca4d(Point=[end.Start, end.End], Tx=True, Ty=True, Tz=True, Rx=True, Ry=True, RZ=True)
assemble_model = AssembleModelAlpaca4d(Element=force_beam_column, Support=support, Load=gravity_load, Tollerance=0.01)  # -> AlpacaModel, MassForce
model_view_alpaca4d = ModelViewAlpaca4d(
    AlpacaModel=assemble_model.AlpacaModel,
    Extruded=Toggle(True),
    Load=boolean_toggle,
    LoadFactor="0.01",
    Support=boolean_toggle,
    SupportFactor=1,
    Constraint=False)  # -> AlpacaModel, Info
getproperty_3 = GetProperty(Obj=getproperty_2, PropName="Material", Component="{ .GetProperty")
getproperty_4 = GetProperty(Obj=getproperty_2, PropName="Iyy", Component="{ .GetProperty")
getproperty_5 = GetProperty(Obj=getproperty_2, PropName="Izz", Component="{ .GetProperty")
num = Number(getproperty)
num_2 = Number("12")
analysissettings = AnalysisSettingsAlpaca4d()
multiplication = Multiplication(A=num, B=gfactor)
bang = ExplodeTree(Data=assemble_model.AlpacaModel)  # -> Branch0, Branch1
ra = RunAnalysisAlpaca4d(AlpacaModel=bang.Branch0, Settings=analysissettings)  # -> Log, AlpacaModel
clr = ColorsAlpaca4d(GradientIndex=11)  # -> reverse(Colors)
panel = Panel(getproperty_4)
getproperty_6 = GetProperty(Obj=getproperty_3, PropName="E", Component="{ .GetProperty")
bang_2 = ExplodeTree(Data=[getproperty_5, getproperty_4])  # -> Branch0, Branch1
getproperty_7 = GetProperty(Obj=force_beam_column, PropName="Section", Component="{ .GetProperty")
getproperty_8 = GetProperty(Obj=force_beam_column, PropName="GeomTransf", Component="{ .GetProperty")
deformed_model_view = DeformedModelViewAlpaca4d(AlpacaModel=ra.AlpacaModel, Step=0, Scale="1000", Colors=clr)  # -> Line, Mesh, Brick
python = GhPythonScript(P=multiplication, L=num_2, E=getproperty_6, I=bang_2.Branch0)  # -> out, a
# ---------- python: Python ----------
__author__ = "MarcoPellegrinoKonsu"
__version__ = "2022.09.09"

import rhinoscriptsyntax as rs

a = 1 * P * L**4/(384*E*I)
# ---------- end python ----------
panel_2 = Panel(getproperty_6)
nd = NodalDisplacementsAlpaca4d(AlpacaModel=ra.AlpacaModel, History=False, Step=0)  # -> Displacement, Rotation, port, Velocity, Acceleration
panel_3 = Panel(python.a)
mjoin = MeshJoin(Meshes=deformed_model_view.Line)
getproperty_9 = GetProperty(Obj=getproperty_7, PropName="Curves", Component="{ .GetProperty")
explode_2 = Explode(Object=getproperty_8, Component="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")  # -> Type, Line, Id, LocalZ, LocalY
vlen = VectorLength(Vector=nd.Displacement)
bang_3 = ExplodeTree(Data=panel_3)  # -> Branch0, Branch1
list_item = ListItem(List=getproperty_9, Index=0, Wrap=True)
sort = SortList(Keys=vlen)  # -> reverse(Keys), ValuesA
item_2 = ListItem(List=sort.Keys, Index=0, Wrap=True)
panel_4 = Panel(explode_2.LocalZ)
panel_5 = Panel(explode_2.LocalY)
end_2 = EndPoints(Curve=explode_2.Line)  # -> Start, End
data = Data(flatten(bang_3.Branch0))
midpt = CurveMiddle(Curve=explode_2.Line)
modelview = ModelViewAlpaca4d(
    AlpacaModel=bang.Branch0,
    Extruded=False,
    Load=False,
    LoadFactor=1,
    Support=Toggle(True),
    SupportFactor=1,
    Constraint=False)  # -> AlpacaModel, Info
pl = ConstructPlane(Origin=[end_2.Start, end_2.End], XAxis=explode_2.LocalZ, YAxis=explode_2.LocalY)
panel_6 = Panel(data)
panel_7 = Panel(item_2)
orient = Orient(Geometry=list_item, Source=PlaneXY(0, 0, 0), Target=pl)  # -> Geometry, Transform
vdisex = VectorDisplayEx(Point=midpt, Vector=panel_5, Colour=ColourSwatch(SwatchColor=RGB(48, 204, 0)), Width="3")
vdisex_2 = VectorDisplayEx(Point=midpt, Vector=panel_4, Colour=ColourSwatch(SwatchColor=RGB(0, 118, 161)), Width="3")
panel_8 = Panel(modelview.Info)
similar = Similarity(FirstNumber=item_2, SecondNumber=panel_6, Threshold="3")  # -> Similarity, AbsoluteDifference
ml = MeshLoftAlpaca4d(Polylines=orient.Geometry)
merge = Merge(Data1=ColourSwatch(SwatchColor=RGB(255, 0, 0)), Data2=ColourSwatch(SwatchColor=RGB(77, 255, 0)))
item_3 = ListItem(List=merge, Index=similar.Similarity, Wrap=True)
preview = CustomPreview(Geometry=ml, Material=ColourSwatch(SwatchColor=RGBA(255, 255, 255, 112)))
legend = Legend(Colour=item_3, Tags=similar.Similarity, LegendType=1)
license = LicenseAlpaca4d()
panel_9 = Panel(license)
