# Grasshopper definition simpli_supported_beam_Release.gh (Grasshopper 1.0.7)
# plug-ins: Alpaca4d

uniaxial_material_elastic = UniaxialMaterialElasticAlpaca4d()
X = UnitX(Factor=1)
pt = Point(Point(0, 0, 0))
i_section = ISectionAlpaca4d(
    Height=0.3,
    TopFlangeWidth=0.15,
    TopFlangeThickness=0.02,
    BottomFlangeWidth=0.2,
    BottomFlangeThickness=0.02,
    Web=0.02,
    Material=uniaxial_material_elastic)
rectanglehollowcs = RectangleHollowAlpaca4d(Width=0.3, Height=0.6, Web=0.02, TopFlange=0.02, BottomFlange=0.02, Material=uniaxial_material_elastic)
circlecs = CircleCSAlpaca4d(Diameter=0.15, Thickness=0.01, Material=uniaxial_material_elastic)
rectanglecs = RectangleCSAlpaca4d(Width=0.3, Height=0.6, Material=uniaxial_material_elastic)
line = LineSDL(Start=pt, Direction=X, Length="12")
list = ValueList({"ipe": 0, "rect": 1, "hollowSquare": 2, "circle": 3}, selected="circle")
divide = DivideCurve(Curve=line, Count="30", Kinks=False)  # -> Points, Tangents, Parameters
pline = PolyLine(Vertices=divide.Points, Closed=False)
filter = StreamFilter(Gate=list, Stream0=i_section, Stream1=rectanglecs, Stream2=rectanglehollowcs, Stream3=circlecs)
explode = Explode(Curve=pline, Recursive=True)  # -> Segments, Vertices
Z = UnitZ(Factor=1)
Y = UnitY(Factor=1)
force_beam_column = ForceBeamColumnAlpaca4d(Line=explode.Segments, Section=filter, ZAxis=Z)

item = ListItem(List=force_beam_column, Index=0, Wrap=True)
getproperty = GhPythonScript(obj=item, prop_name="MassDens")  # -> value
# ---------- getproperty: Python ----------
__author__ = "Marco"
__version__ = "2023.01.21"

import rhinoscriptsyntax as rs


value = getattr(obj, prop_name)
# ---------- end getproperty ----------
getproperty_2 = GhPythonScript(obj=item, prop_name="Section")  # -> value; same code as getproperty
getproperty_3 = GhPythonScript(obj=item, prop_name="GeomTransf")  # -> value; same code as getproperty
num = Number(getproperty)
getproperty_4 = GhPythonScript(obj=getproperty_3, prop_name="LocalZ")  # -> value; same code as getproperty
gfactor = GFactor(9.81)
getproperty_5 = GhPythonScript(obj=getproperty_2, prop_name="Material")  # -> value; same code as getproperty
getproperty_6 = GhPythonScript(obj=getproperty_2, prop_name="Iyy")  # -> value; same code as getproperty
getproperty_7 = GhPythonScript(obj=getproperty_2, prop_name="Izz")  # -> value; same code as getproperty
num_2 = Number("12")
multiplication = Multiplication(A=num, B=gfactor)
python = GhPythonScript(z=getproperty_4, x=getproperty_6, y=getproperty_7)  # -> out, a; inputs z: Vector3d
# ---------- python: Python ----------
__author__ = "Marco"
__version__ = "2023.01.21"

import rhinoscriptsyntax as rs
import Rhino.Geometry as rg

if z == rg.Vector3d(0,1,0):
    a = y
elif z == rg.Vector3d(0,0,1):
    a = x
# ---------- end python ----------
getproperty_8 = GhPythonScript(obj=getproperty_5, prop_name="E")  # -> value; same code as getproperty
python_2 = GhPythonScript(P=multiplication, L=num_2, E=getproperty_8, I=python.a)  # -> out, a
# ---------- python_2: Python ----------
__author__ = "MarcoPellegrinoKonsu"
__version__ = "2022.09.09"

import rhinoscriptsyntax as rs

a = 1 * P * L**4/(384*E*I)
# ---------- end python_2 ----------
data = Data(flatten(python_2.a))

end = EndPoints(Curve=line)  # -> Start, End
gravity_load = GravityLoadAlpaca4d(TimeSeriesType="Constant", GFactor=9.81)
support = SupportAlpaca4d(Point=[end.Start, end.End], Tx=True, Ty=True, Tz=True, Rx=True, Ry=True, RZ=True)
assemble_model = AssembleModelAlpaca4d(Element=force_beam_column, Support=support, Load=gravity_load, Tollerance=0.01)  # -> AlpacaModel, MassForce
analysissettings = AnalysisSettingsAlpaca4d()
bang = ExplodeTree(Data=assemble_model.AlpacaModel)  # -> Branch0, Branch1
ra = RunAnalysisAlpaca4d(AlpacaModel=bang.Branch0, Settings=analysissettings)  # -> Log, AlpacaModel
clr = ColorsAlpaca4d(GradientIndex=11)  # -> reverse(Colors)
deformed_model_view = DeformedModelViewAlpaca4d(AlpacaModel=ra.AlpacaModel, Step=0, Scale="40", Colors=clr)  # -> Line, Mesh, Brick

element = Data(force_beam_column)
getproperty_9 = GhPythonScript(obj=element, prop_name="GeomTransf")  # -> value; same code as getproperty
getproperty_10 = GhPythonScript(obj=getproperty_9, prop_name="LocalZ")  # -> value; same code as getproperty
getproperty_11 = GhPythonScript(obj=getproperty_9, prop_name="LocalY")  # -> value; same code as getproperty
getproperty_12 = GhPythonScript(obj=getproperty_9, prop_name="Line")  # -> value; same code as getproperty
panel = Panel(getproperty_10)
panel_2 = Panel(getproperty_11)
midpt = CurveMiddle(Curve=getproperty_12)
vdisex = VectorDisplayEx(Point=midpt, Vector=panel_2, Colour=ColourSwatch(SwatchColor=RGB(48, 204, 0)), Width="3")
vdisex_2 = VectorDisplayEx(Point=midpt, Vector=panel, Colour=ColourSwatch(SwatchColor=RGB(0, 118, 161)), Width="3")

nd = NodalDisplacementsAlpaca4d(AlpacaModel=ra.AlpacaModel, History=False, Step=0)  # -> Displacement, Rotation, port, Velocity, Acceleration
mjoin = MeshJoin(Meshes=deformed_model_view.Line)
vlen = VectorLength(Vector=nd.Displacement)
sort = SortList(Keys=vlen)  # -> reverse(Keys), ValuesA
item_2 = ListItem(List=sort.Keys, Index=0, Wrap=True)
panel_3 = Panel(data)
panel_4 = Panel(item_2)
similar = Similarity(FirstNumber=item_2, SecondNumber=panel_3, Threshold="5")  # -> Similarity, AbsoluteDifference
merge = Merge(Data1=ColourSwatch(SwatchColor=RGB(255, 0, 0)), Data2=ColourSwatch(SwatchColor=RGB(77, 255, 0)))
item_3 = ListItem(List=merge, Index=similar.Similarity, Wrap=True)
legend = Legend(Colour=item_3, Tags=similar.Similarity, LegendType=1)
legend_2 = Legend(Colour=item_3, Tags=similar.Similarity, LegendType=1)
