# Grasshopper definition CreateModel.gh (Grasshopper 1.0.7)
# plug-ins: Alpaca4d, BH.UI.Grasshopper, Kangaroo2 Components, Pufferfish, Karamba3D, Wombat

Y = UnitY(Factor=1)
pt = Point(Point(0, 0, 0))
X = UnitX(Factor=1)
genes = GenePool(Decimals=2, Maximum=1, Minimum=0, Value=[0, 0.5])
uniaxial_material_elastic = UniaxialMaterialElasticAlpaca4d()
line = LineSDL(Start=pt, Direction=X, Length="500")
shatter = Shatter(Curve=reparameterize(line), Parameters=genes)
matprops = MaterialPropertiesKaramba3D(
    FamilyOfMaterial="Steel",
    Name="S235",
    YoungsModulus_kN_cm2=21000,
    InPlaneShearModulus_kN_cm2=8076,
    TransverseShearModulus_kN_cm2=8076,
    SpecificWeight_kN_m3=78.5,
    CoefficientOfThermalExpansion_1_C=1.2e-05,
    TensileStrength_kN_cm2=23.5,
    CompressiveStrength_kN_cm2=-23.5,
    StrengthHypothesis="MISES",
    mode="Isotrop")
divide_target = DivideByTargetLength(Curve=shatter, Length="50")  # -> Points, Tangents, Parameters
uniaxial_material_elastic_2 = UniaxialMaterialElasticAlpaca4d(MaterialName="myMaterial", E="21000", Eneg="21000", Eta="0.3", G="8000", V="0.3", Rho="7850")
circlecs = CircleCSAlpaca4d(SectionName="mySection", Diameter="22", Thickness="0.1", Material=uniaxial_material_elastic_2)
pline = PolyLine(Vertices=divide_target.Points, Closed=False)
panel = Panel("200")
panel_2 = Panel("100")
explode = Explode(Curve=pline, Recursive=True)  # -> Segments, Vertices
Z = UnitZ(Factor=1)
circlecs_2 = CircleCSAlpaca4d(SectionName="mySection", Diameter="40", Thickness="0.2", Material=uniaxial_material_elastic_2)
duppt = RemoveDuplicatePts(Points=flatten(explode.Vertices), Tolerance=0.01)
move = Move(Geometry=explode.Segments, Motion=Z)  # -> Geometry, Transform
duppt_2 = RemoveDuplicatePts(Points=flatten(explode.Vertices), Tolerance=0.01)
lng = ListLength(List=duppt)
panel_3 = Panel(circlecs_2)
explode_2 = Explode(Recursive=True)  # -> Segments, Vertices
series = Series(Start=0, Step=1, Count=lng)
item = ListItem(List=explode.Vertices, Index="3", Wrap=True)
dupln = RemoveDuplicateLines(Lines=flatten(explode.Segments), Tolerance=0.01)
panel_4 = Panel(series)
constant_time_series = ConstantTimeSeriesAlpaca4d(ConstantFactor="1")  # -> TimeSeries, Graph
linear_time_series = LinearTimeSeriesAlpaca4d(LinearFactor="1")  # -> TimeSeries, Graph
duppt_3 = RemoveDuplicatePts(Points=flatten(item), Tolerance=0.01)
eval = EvaluateCurve(Curve=reparameterize(line), Parameter=genes)  # -> Point, Tangent, Angle
x_plus_one = XPlusOne()
Z_2 = UnitZ(Factor="-200")
toggle = BooleanToggle(True)
X_2 = UnitX(Factor=1)
Z_3 = UnitZ(Factor=1)
explode_3 = Explode(Object=constant_time_series.TimeSeries, Component="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")  # -> Type, CFactor, Id
toggle_2 = BooleanToggle(True)
toggle_3 = BooleanToggle(True)
vec = VectorXYZ(XComponent=0, YComponent="0.20", ZComponent="0.20")  # -> Vector, Length
force_beam_column = ForceBeamColumnAlpaca4d(Line=dupln, Section=circlecs_2)
mp = MassPoint(Point=duppt, TransMass=Z_3, RotationalMass=Vector(0, 0, 0))
point_load = PointLoadAlpaca4d(Point=duppt, Force=Z_2, Moment=Vector(0, 0, 0), TimeSeries=linear_time_series.TimeSeries)
support = SupportAlpaca4d(Point=eval.Point, Tx=toggle_3, Ty=toggle_3, Tz=toggle_3, Rx=toggle_3, Ry=toggle_3, RZ=toggle_3)
explode_4 = Explode(Object=force_beam_column, Component="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")  # -> Curve, Section, GeomTransf, BeamIntegration, LocalZAxis, Type, Id, INode, JNode, Ndf
data = Data(flatten(force_beam_column))
merge = Merge(Data1=point_load, Data2=mp)
explode_5 = Explode(Object=explode_4.GeomTransf, Component="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")  # -> Type, Line, Id, ZAxis, RefVector
assemble_model = AssembleModelAlpaca4d(Element=flatten(data), Support=flatten(support), Load=flatten(merge), Tollerance=0.01)  # -> AlpacaModel, Tcl
crv = Curve(explode_5.Line)
analysisstep = AnalysisStepAlpaca4d(NumIncr="4")
multiplication = Multiplication(A=explode_5.ZAxis, B="100")
multiplication_2 = Multiplication(A=explode_5.RefVector, B="100")
midpt = CurveMiddle(Curve=explode_5.Line)
python = GhPythonScript()  # -> Out, A
vdisex = VectorDisplayEx(Point=midpt, Vector=multiplication_2, Colour=ColourSwatch(SwatchColor=RGB(51, 0, 204)), Width=2)
analysissettings = AnalysisSettingsAlpaca4d(AnalysisSteps=analysisstep)
ra = RunAnalysis(AlpacaModel=assemble_model.AlpacaModel, Settings=analysissettings)  # -> Log, AlpacaModel
panel_5 = Panel(ra.Log)
relay = Relay()  # disabled
vdisex_2 = VectorDisplayEx(Point=midpt, Vector=multiplication, Colour=ColourSwatch(SwatchColor=RGB(92, 204, 0)), Width=2)
panel_6 = Panel("2")  # disabled
# Need to turn Red if Error
panel_7 = Panel(ra.AlpacaModel)
bf = BeamForcesAlpaca4d(AlpacaModel=relay, History=False, Step=panel_6)  # -> N, Vy, Vz, Mx, My, Mz; disabled
bnd = Bounds(Numbers=flatten(bf.Vy))
dedomain = DeconstructDomain(Domain=bnd)  # -> Start, End
abs = Absolute(Value=dedomain.Start)
abs_2 = Absolute(Value=dedomain.End)
max = Maximum(A=abs, B=abs_2)
python_2 = GhPythonScript(x=relay)  # -> out, a
# ---------- python_2: Python ----------
a = x.Beams
# ---------- end python_2 ----------
division = Division(A=dedomain.Start, B=max)
division_2 = Division(A=dedomain.End, B=max)
analysissettings_2 = AnalysisSettingsAlpaca4d()
number_slider = Slider(100, range=1..100)
python_3 = GhPythonScript(x=python_2.a)  # -> out, a
# ---------- python_3: Python ----------
a = x.Curve
# ---------- end python_3 ----------
nodal_displacement = NodalDisplacementAlpaca4d(AlpacaModel=ra.AlpacaModel, History=False, Step=Slider(2, range=0..17))  # -> Displacement, Rotation, port, Velocity, Acceleration
panel_8 = Panel(bf.Vy)
item_2 = ListItem(Index="1", Wrap=True)
crv_2 = Curve(python_3.a)
panel_9 = Panel(nodal_displacement.Displacement)
panel_10 = Panel("-100 to 100")
multiplication_3 = Multiplication(A=division, B=number_slider)
multiplication_4 = Multiplication(A=division_2, B=number_slider)
dom = ConstructDomain(DomainStart=multiplication_3, DomainEnd=multiplication_4)
subtraction = Subtraction(A="5", B=1)
remap = RemapNumbers(Value=bf.Vy, Source=bnd, Target=dom)  # -> Mapped, Clipped
python_4 = GhPythonScript()  # -> out, a, b, c
# ---------- python_4: Python ----------
a = x.Recorders
b = x.Tcl

c = x.Nodes

x.Nodes
# ---------- end python_4 ----------
python_5 = GhPythonScript()  # -> out, a, b
# ---------- python_5: Python ----------
a = x.Recorders
b = x.Tcl
# ---------- end python_5 ----------
divide = DivideCurve(Curve=crv_2, Count=subtraction, Kinks=False)  # -> Points, Tangents, Parameters
explode_6 = Explode(Object=python_4.c, Component="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")  # -> Pos, Id, Ndf, Mass
Z_4 = UnitZ(Factor=remap.Mapped)
split = TextSplit(Text=item_2)
panel_11 = Panel("10000")
move_2 = Move(Geometry=divide.Points, Motion=Z_4)  # -> Geometry, Transform
panel_12 = Panel(python_5.b)
multiplication_5 = Multiplication(A=nodal_displacement.Displacement, B=Slider(2, range=1..100))
panel_13 = Panel("""         OpenSees -- Open System For Earthquake Engineering Simulation
                 Pacific Earthquake Engineering Research Center
                        Version 3.4.0 64-Bit

      (c) Copyright 1999-2016 The Regents of the University of California
                              All Rights Reserved
  (Copyright and Disclaimer @ http://www.berkeley.edu/OpenSees/copyright.html)


MPCO recorder - Written by ASDEA Software Technology: M.Petracca, G.Camata
ASDEA Software Technology: https://asdeasoft.net 
STKO (Scientific ToolKit for OpenSees): https://asdeasoft.net/stko/ 
If you use this tool, please cite us:
Petracca, M., Candeloro, F., & Camata, G. (2017). "STKO user manual". ASDEA Software Technology, Pescara Italy.""")
move_3 = Move(Geometry=explode_6.Pos, Motion=multiplication_5)  # -> Geometry, Transform
len = TextLength(Text=panel_13)
lng_2 = ListLength()
panel_14 = Panel(len)
intcrv = Interpolate(Vertices=move_3.Geometry, Degree=3, Periodic=False, KnotStyle=1)  # -> Curve, Length, Domain
panel_15 = Panel(split)
rf = ReactionForceAlpaca4d(History=False, Step=0)  # -> SupportPosition, ReactionForce, ReactionMoment; disabled
panel_16 = Panel(rf.SupportPosition)  # disabled
panel_17 = Panel(rf.ReactionForce)  # disabled
explode_7 = Explode(Object=rf.SupportPosition, Component="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")  # -> Pos, Tx, Ty, Tz, Rx, Ry, Rz, Id, Ndf
pt_2 = Point(explode_7.Pos)
vdisex_3 = VectorDisplayEx(Point=pt_2, Vector=rf.ReactionForce, Colour=RGB(0, 0, 0), Width=2)
