# Grasshopper definition deserialise.gh (Grasshopper 1.0.7)
# plug-ins: Alpaca4d

path = FilePath("C:\GitHub\OpenSeesGh\Tests\Gh\Deserialise\AlpacaModel")
path_2 = FilePath("C:\GitHub\OpenSeesGh\Tests\Gh\brick\AlpacaModel")
file = ReadFile(File=path_2, PerLineParse=True)
dslrz = DeserialiseAlpaca4d(FilePath=path_2)  # -> Points, Lines, ShellMesh, BrickMesh
geo = Geometry()
item = ListItem(Index=0, Wrap=True)
panel = Panel(file)
geo_2 = Geometry()
ln = Line()
dslrz_2 = DeserialiseAlpaca4d(Text=file)  # -> Points, Lines, ShellMesh, BrickMesh
