# Grasshopper definition fiberTest.gh (Grasshopper 1.0.7)
# plug-ins: Alpaca4d, BH.UI.Grasshopper

panel = Panel("24")  # disabled
panel_2 = Panel("15")  # disabled
panel_3 = Panel("300")  # disabled
rectangle = Rectangle(Plane=PlaneXY(0, 0, 0), XSize=panel, YSize=panel_2, Radius=0)  # -> Rectangle, Length; disabled
crv = Curve(rectangle.Rectangle)  # disabled
explode = Explode(Curve=crv, Recursive=True)  # -> flatten(Segments), Vertices; disabled
boundary = BoundarySurfaces(Edges=explode.Segments)  # disabled
debrep = DeconstructBrep(Brep=boundary)  # -> Faces, Edges, Vertices; disabled
join = JoinCurves(Curves=debrep.Edges, Preserve=False)  # disabled
panel_4 = Panel("-0.014")  # disabled
panel_5 = Panel("-5")  # disabled
panel_6 = Panel("-0.004")  # disabled
panel_7 = Panel("-6")  # disabled
panel_8 = Panel("0.01")  # disabled
panel_9 = Panel("60")  # disabled
panel_10 = Panel("30000")  # disabled
panel_11 = Panel("-1.5")  # disabled
concrete01 = Concrete01Alpaca4d(Fco=panel_7, Fcu=panel_5, EpsilonCo=panel_6, EpsilonCu=panel_4, MinMax=False)  # disabled
steel01 = Steel01Alpaca4d(Fy=panel_9, E0=panel_10, B=panel_8)  # disabled
offset = OffsetCurve(Curve=join, Distance=panel_11, Corners=1)  # disabled
area = Area(Geometry=crv)  # -> Area, Centroid; disabled
explode_2 = Explode(Curve=offset, Recursive=True)  # -> Segments, Vertices; disabled
crv_2 = Curve(explode_2.Segments)  # disabled
scale = Scale(Geometry=crv, Center=area.Centroid, Factor=0.5)  # -> Geometry, Transform; disabled
python = GhPythonScript(x=steel01)  # -> out, a; disabled
# ---------- python: Python ----------
__author__ = "MarcoPellegrinoKonsu"
__version__ = "2022.08.09"

import rhinoscriptsyntax as rs

x.Id = 1

a = x
# ---------- end python ----------
explode_3 = Explode(Curve=crv_2, Recursive=True)  # -> flatten(Segments), Vertices; disabled
panel_12 = Panel("10")  # disabled
srf = Surface(crv)  # disabled
crv_3 = Curve([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])  # disabled
panel_13 = Panel("300")
mesh_uv = MeshSurface(Surface=srf, UCount=panel_12, VCount=panel_12, Overhang=True, Equalize=False)  # disabled
debrep_2 = DeconstructBrep(Brep=scale.Geometry)  # -> Faces, Edges, flatten(Vertices); disabled
python_2 = GhPythonScript(x=concrete01)  # -> out, a; disabled
# ---------- python_2: Python ----------
__author__ = "MarcoPellegrinoKonsu"
__version__ = "2022.08.09"

import rhinoscriptsyntax as rs

x.Id = 2

a = x
# ---------- end python_2 ----------
panel_14 = Panel("10000000")  # disabled
panel_15 = Panel("0.60")  # disabled
rectangle_2 = Rectangle(Plane=PlaneXY(0, 0, 0), XSize="16", YSize="24", Radius=0)  # -> Rectangle, Length
panel_16 = Panel("3")  # disabled
loft = Loft(Curves=crv_3, Options={Adjust=False, Closed=False, LoftEnds=0, LoftSimp=0, LoftType=0, Rebuild=10, Refit=0.01})  # disabled
int = Integer(panel_15)  # disabled
panel_17 = Panel("10")  # disabled
layer_fiber = LayerFiberAlpaca4d(Curve=flatten(explode_3.Segments), NumberOfFibers=panel_16, AreaFiber=int, Material=python.a)  # disabled
mesh_uv_2 = MeshSurface(Surface=loft, UCount=panel_17, VCount=panel_17, Overhang=True, Equalize=False)  # disabled
crv_4 = Curve(rectangle_2.Rectangle)
fiber_point = FiberPointAlpaca4d(Point=debrep_2.Vertices, AreaFiber=panel_14, Material=python.a)  # disabled
patch = PatchAlpaca4d(Mesh=mesh_uv, Material=python_2.a)  # disabled
cir = Circle(Plane=PlaneXY(0, 0, 0), Radius=Slider(0.45, range=0..1))
explode_4 = Explode(Curve=crv_4, Recursive=True)  # -> flatten(Segments), Vertices
debrep_3 = DeconstructBrep(Brep=loft)  # -> Faces, Edges, Vertices; disabled
area_2 = Area(Geometry=cir)  # -> Area, Centroid
boundary_2 = BoundarySurfaces(Edges=explode_4.Segments)
debrep_4 = DeconstructBrep(Brep=boundary_2)  # -> Faces, Edges, Vertices
panel_18 = Panel(area_2.Area)
panel_19 = Panel("1e4")  # disabled
join_2 = JoinCurves(Curves=debrep_3.Edges, Preserve=False)  # disabled
fibersection = FiberSectionAlpaca4d(Layer=layer_fiber, Patch=patch, GJ=panel_19)
panel_20 = Panel("-0.014")  # disabled
panel_21 = Panel("-5")  # disabled
panel_22 = Panel("-0.004")  # disabled
panel_23 = Panel("-6")  # disabled
join_3 = JoinCurves(Curves=debrep_4.Edges, Preserve=False)
panel_24 = Panel("0.01")  # disabled
panel_25 = Panel("60")  # disabled
panel_26 = Panel("30000")  # disabled
panel_27 = Panel("-1.5")  # disabled
concrete01_2 = Concrete01Alpaca4d(Fco=panel_23, Fcu=panel_21, EpsilonCo=panel_22, EpsilonCu=panel_20, MinMax=False)  # disabled
steel01_2 = Steel01Alpaca4d(Fy=panel_25, E0=panel_26, B=panel_24)  # disabled
merge = Merge(Data1=fibersection, Data2=concrete01)  # disabled
offset_2 = OffsetCurve(Curve=join_2, Distance=panel_27, Corners=1)  # disabled
panel_28 = Panel("0.005")  # disabled
panel_29 = Panel("1000")  # disabled
panel_30 = Panel("y")  # disabled
panel_31 = Panel("-180")  # disabled
concrete01_3 = Concrete01Alpaca4d(Fco="-4", Fcu="0.00", EpsilonCo="-0.002", EpsilonCu="-0.006", MinMax=False)
steel01_3 = Steel01Alpaca4d(Fy="60", E0="29000", B="0.00")
explode_5 = Explode(Curve=offset_2, Recursive=True)  # -> Segments, Vertices; disabled
python_3 = GhPythonScript(x=flatten(merge))  # -> out, a; disabled
# ---------- python_3: Python ----------
__author__ = "MarcoPellegrinoKonsu"
__version__ = "2022.08.09"

import rhinoscriptsyntax as rs

a = x.WriteTcl()
# ---------- end python_3 ----------
offset_3 = OffsetCurve(Curve=join_3, Distance="-2.5", Corners=1)
mc = MomentCurvatureAlpaca4d(FiberSection=fibersection, Axial=panel_31, Direction=panel_30, NumIncr=panel_29, MaxPhi=panel_28)  # -> Log, Output, Error, N, My, Mz, Ε, Κy; disabled
explode_6 = Explode(Curve=offset_3, Recursive=True)  # -> Segments, Vertices
crv_5 = Curve(explode_5.Segments)  # disabled
python_4 = GhPythonScript(x=steel01_2)  # -> out, a; disabled; same code as python
crv_6 = Curve(explode_6.Segments)
explode_7 = Explode(Curve=crv_5, Recursive=True)  # -> flatten(Segments), Vertices; disabled
panel_32 = Panel("10")  # disabled
graph = QuickGraph(mc.Ε, SortOrder=0)  # disabled
python_5 = GhPythonScript(x=steel01_3)  # -> out, a; same code as python
panel_33 = Panel(python_3.a)  # disabled
bnd = Bounds(Numbers=mc.Mz)  # disabled
srf_2 = Surface(loft)  # disabled
explode_8 = Explode(Curve=crv_6, Recursive=True)  # -> flatten(Segments), Vertices
item = ListItem(List=explode_8.Segments, Index="2", Wrap=True)
mesh_uv_3 = MeshSurface(Surface=srf_2, UCount=panel_32, VCount=panel_32, Overhang=True, Equalize=False)  # disabled
python_6 = GhPythonScript(x=concrete01_2)  # -> out, a; disabled; same code as python_2
srf_3 = Surface(crv_4)
panel_34 = Panel("0.60")  # disabled
panel_35 = Panel("3")  # disabled
int_2 = Integer(panel_34)  # disabled
mesh_uv_4 = MeshSurface(Surface=srf_3, UCount="20", VCount="20", Overhang=True, Equalize=False)
python_7 = GhPythonScript(x=concrete01_3)  # -> out, a; same code as python_2
layer_fiber_2 = LayerFiberAlpaca4d(Curve=flatten(explode_7.Segments), NumberOfFibers=panel_35, AreaFiber=int_2, Material=python_4.a)  # disabled
fiber_point_2 = FiberPointAlpaca4d()  # disabled
layer_fiber_3 = LayerFiberAlpaca4d(Curve=flatten(item), NumberOfFibers="3", AreaFiber="0.79", Material=python_5.a)
patch_2 = PatchAlpaca4d(Mesh=mesh_uv_3, Material=python_6.a)  # disabled
patch_3 = PatchAlpaca4d(Mesh=mesh_uv_4, Material=python_7.a)
panel_36 = Panel("1e4")  # disabled
explode_9 = Explode(Object=layer_fiber_3, Component="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")  # -> Curve, NumberOfFibers, AreaFiber, Material, Fibers
fibersection_2 = FiberSectionAlpaca4d(Layer=layer_fiber_2, Patch=patch_2, GJ=panel_36)
fibersection_3 = FiberSectionAlpaca4d(Layer=layer_fiber_3, Patch=patch_3, GJ=100000000)
fibersection_4 = FiberSectionAlpaca4d(Layer=layer_fiber_2, Patch=patch_2, GJ=panel_36)  # disabled
path = FilePath("C:\GitHub\Alpaca4d\Tests\Gh\MomentCurvature\MKsectionForce.xml")  # disabled
panel_37 = Panel("0.005")  # disabled
panel_38 = Panel("1000")  # disabled
panel_39 = Panel("-180")  # disabled
panel_40 = Panel("y")  # disabled
file = ReadFile(File=path, PerLineParse=True)  # disabled
num = Number(panel_39)  # disabled
num_2 = Number(panel_38)  # disabled
num_3 = Number(panel_37)  # disabled
panel_41 = Panel("0.005")  # disabled
panel_42 = Panel(" ")  # disabled
panel_43 = Panel("1000")  # disabled
panel_44 = Panel("-180")  # disabled
split = SplitList()  # -> ListA, ListB; disabled
panel_45 = Panel("y")  # disabled
explode_10 = Explode(Object=fibersection_3, Component="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")  # -> Id, PointFibers, Patches, Layers, Fibers, GJ
num_4 = Number(panel_43)  # disabled
num_5 = Number(panel_41)  # disabled
num_6 = Number(panel_44)  # disabled
mc_2 = MomentCurvatureAlpaca4d(FiberSection=fibersection_4, Axial=num, Direction=panel_40, NumIncr=num_2, MaxPhi=num_3)  # -> Log, N, My, Mz, Ε, Κy, Κz, FiberStressStrain; disabled
split_2 = TextSplit(Text=file, Separators=panel_42)  # disabled
panel_46 = Panel("2")  # disabled
panel_47 = Panel("1")  # disabled
mc_3 = MomentCurvatureAlpaca4d(FiberSection=fibersection_3, Axial="0.00", Direction="y", NumIncr="1000", MaxPhi="0.003")  # -> Log, N, My, Mz, Ε, Κy, Κz, FiberStressStrain
mc_4 = MomentCurvatureAlpaca4d(Axial=num_6, Direction=panel_45, NumIncr=num_4, MaxPhi=num_5)  # -> Log, N, My, Mz, Ε, Κy, Κz, FiberStressStrain; disabled
item_2 = ListItem(List=split_2, Index=panel_46, Wrap=True)  # -> flatten(Item); disabled
item_3 = ListItem(List=split_2, Index=panel_47, Wrap=True)  # -> flatten(Item); disabled
explode_11 = Explode(Object=explode_10.Patches, Component="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")  # -> PatchGeometry, Material, Fibers
explode_12 = Explode(Object=explode_10.Layers, Component="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")  # -> Curve, NumberOfFibers, AreaFiber, Material, Fibers
fiber_stress_strain = FiberStressStrainAlpaca4d(FiberStressStrain=mc_3.FiberStressStrain)  # -> FiberPoint, Stress, Strain; disabled
# # Estimate yield curvature
# # (Assuming no axial load and only top and bottom steel)
# set d [expr $colDepth-$cover]	;# d -- from cover to rebar
# set epsy [expr $fy/$E]	;# steel yield strain
# set Ky [expr $epsy/(0.7*$d)]
bnd_2 = Bounds(Numbers=item_2)  # disabled
fiber_stress_strain_2 = FiberStressStrainAlpaca4d(FiberStressStrain=mc_2.FiberStressStrain)  # -> FiberPoint, Stress, Strain; disabled
graph_2 = QuickGraph(item_2, SortOrder=0)  # disabled
graph_3 = QuickGraph(item_3, SortOrder=0)  # disabled
panel_48 = Panel(bnd_2)  # disabled
fiber_stress_strain_3 = FiberStressStrainAlpaca4d(FiberStressStrain=mc_4.FiberStressStrain)  # -> FiberPoint, Stress, Strain; disabled
graph_4 = QuickGraph(mc_3.Mz, SortOrder=0)
panel_49 = Panel("40")  # disabled
panel_50 = Panel("400")  # disabled
deconstruct_fiber_point = DeconstructFiberPointAlpaca4d(FiberPoint=fiber_stress_strain_2.FiberPoint)  # -> Pos, Area, Material; disabled
graph_5 = QuickGraph(fiber_stress_strain_2.Strain, SortOrder=0)  # disabled
graph_6 = QuickGraph(fiber_stress_strain_2.Stress, SortOrder=0)  # disabled
branch = TreeBranch(Tree=fiber_stress_strain.Strain, Path=panel_49, MaintainPaths=True)  # disabled
branch_2 = TreeBranch(Tree=fiber_stress_strain.Stress, Path=panel_49, MaintainPaths=True)  # disabled
branch_3 = TreeBranch(Tree=fiber_stress_strain.Strain, Path=panel_50, MaintainPaths=True)  # disabled
branch_4 = TreeBranch(Tree=fiber_stress_strain.Stress, Path=panel_50, MaintainPaths=True)  # disabled
deconstruct_fiber_point_2 = DeconstructFiberPointAlpaca4d(FiberPoint=fiber_stress_strain_3.FiberPoint)  # -> Pos, Area, Material; disabled
deconstruct_fiber_point_3 = DeconstructFiberPointAlpaca4d(FiberPoint=fiber_stress_strain.FiberPoint)  # -> flatten(Pos), Area, Material; disabled
graph_7 = QuickGraph(fiber_stress_strain_3.Strain, SortOrder=0)  # disabled
graph_8 = QuickGraph(fiber_stress_strain_3.Stress, SortOrder=0)  # disabled
panel_51 = Panel(mc_3.Log)  # disabled
num_7 = Number(branch)  # disabled
num_8 = Number(branch_2)  # disabled
num_9 = Number(branch_3)  # disabled
num_10 = Number(branch_4)  # disabled
bnd_3 = Bounds(Numbers=num_7)  # disabled
panel_52 = Panel("0.3")  # disabled
bnd_4 = Bounds(Numbers=num_9)  # disabled
bnd_5 = Bounds(Numbers=num_8)  # disabled
bnd_6 = Bounds(Numbers=num_10)  # disabled
points = PointList(Points=deconstruct_fiber_point_3.Pos, Size=panel_52)  # disabled
remap = RemapNumbers(Value=num_7, Source=bnd_3, Target=Domain(0, 1))  # -> Mapped, Clipped; disabled
remap_2 = RemapNumbers(Value=num_8, Source=bnd_5, Target=Domain(0, 1))  # -> Mapped, Clipped; disabled
remap_3 = RemapNumbers(Value=num_9, Source=bnd_4, Target=Domain(0, 1))  # -> Mapped, Clipped; disabled
remap_4 = RemapNumbers(Value=num_10, Source=bnd_6, Target=Domain(0, 1))  # -> Mapped, Clipped; disabled
pt = ConstructPoint(XCoordinate=remap_2.Mapped, YCoordinate=remap.Mapped, ZCoordinate=0)  # disabled
pt_2 = ConstructPoint(XCoordinate=remap_4.Mapped, YCoordinate=remap_3.Mapped, ZCoordinate=0)  # disabled
pline = PolyLine(Vertices=pt, Closed=False)  # disabled
pline_2 = PolyLine(Vertices=pt_2, Closed=False)  # disabled
path_2 = FilePath("C:\GitHub\Alpaca4d\Tests\Gh\MomentCurvature\MKsectionForce.xml")  # disabled
panel_53 = Panel(" ")  # disabled
file_2 = ReadFile(File=path_2, PerLineParse=True)  # disabled
split_3 = SplitList()  # -> ListA, ListB; disabled
split_4 = TextSplit(Text=file_2, Separators=panel_53)  # disabled
panel_54 = Panel("2")  # disabled
panel_55 = Panel("1")  # disabled
item_4 = ListItem(List=split_4, Index=panel_54, Wrap=True)  # -> flatten(Item); disabled
item_5 = ListItem(List=split_4, Index=panel_55, Wrap=True)  # -> flatten(Item); disabled
bnd_7 = Bounds(Numbers=item_4)  # disabled
graph_9 = QuickGraph(item_4, SortOrder=0)  # disabled
graph_10 = QuickGraph(item_5, SortOrder=0)  # disabled
panel_56 = Panel(bnd_7)  # disabled
panel_57 = Panel("C:\GitHub\Alpaca4d\Tests\Gh\Fiber\MKsectionStressFiber.out")  # disabled
path_3 = FilePath(panel_57)  # disabled
file_3 = ReadFile(File=path_3, PerLineParse=True)  # disabled
panel_58 = Panel(" ")  # disabled
split_5 = SplitList()  # -> ListA, ListB; disabled
split_6 = TextSplit(Text=file_3, Separators=panel_58)  # -> simplify(Result); disabled
item_6 = ListItem(List=split_6, Index=0, Wrap=True)  # -> flatten(Item), flatten(Item1); disabled
graph_11 = QuickGraph(item_6.Item, SortOrder=0)  # disabled
graph_12 = QuickGraph(item_6.Item1, SortOrder=0)  # disabled
