# Grasshopper definition ASDShellQ4.gh (Grasshopper 1.0.7)
# plug-ins: Alpaca4d, Kangaroo2 Components, MeshEdit Components, BH.UI.Grasshopper, Pufferfish, Wombat

eim = ElasticIsotropicMaterialAlpaca4d(MaterialName="myMaterial", E="2.1e11", G="8.4e10", V="0.30", Rho="25000")
constant_time_series = ConstantTimeSeriesAlpaca4d(ConstantFactor=1)  # -> TimeSeries, Graph
rectangle = Rectangle(Plane=PlaneXY(0, 0, 0), XSize=Slider(5, range=0..10), YSize="10", Radius=0)  # -> Rectangle, Length
fs = FiberSectionAlpaca4d(Thickness="0.15", Material=eim)
Y = UnitY(Factor="10000")
Z = UnitZ(Factor=1)
uniaxial_material_elastic = UniaxialMaterialElasticAlpaca4d(MaterialName="myMaterial", E="2.1e11", Eneg="2.1e11", Eta="0.00", G="8.4e10", V="0.30", Rho="25000")
mplane = MeshPlane(Boundary=rectangle.Rectangle, WidthCount="30", HeightCount="60")  # -> Mesh, Area
nv = NakedVertices(Mesh=mplane.Mesh)  # -> ClothedIndex, NakedIndex, ClothedPts, NakedPts
geo = Geometry(nv.NakedPts)
linear_time_series = LinearTimeSeriesAlpaca4d(LinearFactor=1)  # -> TimeSeries, Graph
demesh = DeconstructMesh(Mesh=mplane.Mesh)  # -> Vertices, Faces, Colours, Normals
mc = MeshCorners(Mesh=mplane.Mesh, Angle=2.35619449)
vec = VectorXYZ(XComponent=0, YComponent="0.10", ZComponent="10000")  # -> Vector, Length
explode = MeshExplode(Mesh=mplane.Mesh, Interpolate=False)  # -> flatten(Faces)
demesh_2 = DeconstructMesh(Mesh=explode)  # -> Vertices, Faces, Colours, Normals
duppt = RemoveDuplicatePts(Points=flatten(demesh_2.Vertices), Tolerance=0.01)
item = ListItem(List=duppt, Index=0, Wrap=True)
jitter = Jitter(List=demesh.Vertices, Jitter=1, Seed=2)  # -> Values, Indices
split = SplitList(List=jitter.Values, Index="20")  # -> ListA, ListB
asdq4 = ASDShellQ4Alpaca4d(Mesh=explode, Section=fs)
mp = MassPoint(Point="1.5,0.5,0.0", TransMass="100,100,100", RotationalMass=Vector(0, 0, 0))
support = SupportAlpaca4d(Point=geo, Tx=True, Ty=True, Tz=True, Rx=True, Ry=True, RZ=True)
lng = ListLength(List=split.ListA)
point_load = PointLoadAlpaca4d(Point=duppt, Force=Z, Moment=Vector(0, 0, 0), TimeSeries=linear_time_series.TimeSeries)  # -> flatten(Load)
series = Series(Start="2", Step="0.5", Count=lng)
range = Range(Domain=Domain(0, 1), Steps="5")
line = LineSDL(Start=split.ListA, Direction=Vector(0, 0, 1), Length=series)
end = EndPoints(Curve=line)  # -> Start, End
geo_2 = Geometry(end.End)
circlecs = CircleCSAlpaca4d(Diameter="0.20", Thickness="0.02", Material=uniaxial_material_elastic)
shatter = Shatter(Curve=reparameterize(line), Parameters=range)
panel = Panel("1")  # disabled
item_2 = ListItem(List=line, Index=0, Wrap=True)
explode_2 = Explode(Object=point_load, Component="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")  # -> Pos, Force, Moment, Ndf, Type, Id, PatternTag, TimeSeries; disabled
analysisstep = AnalysisStepAlpaca4d(NumIncr=panel)  # disabled
force_beam_column = ForceBeamColumnAlpaca4d(Line=shatter, Section=circlecs)  # -> flatten(Element)
data = Data(flatten([force_beam_column, asdq4]))
assemble_model = AssembleModelAlpaca4d(Element=data, Support=support, Load=flatten([point_load, mp]), Tollerance=0.01)  # -> AlpacaModel, Tcl
explode_3 = Explode(Object=circlecs, Component="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")  # -> Diameter, Thickness, Area, AlphaY, AlphaZ, Iyy, Izz, J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
panel_2 = Panel(assemble_model.Tcl)
explode_4 = Explode(Component="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")
analysissettings = AnalysisSettingsAlpaca4d(AnalysisSteps=analysisstep)  # disabled
explode_5 = Explode(Object=force_beam_column, Component="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")  # -> Curve, Section, GeomTransf, BeamIntegration, LocalZAxis, Type, Id, INode, JNode, Ndf
nv_2 = NaturalVibrationAnalysisAlpaca4d(AlpacaModel=assemble_model.AlpacaModel, VibrationModes="5")  # -> Log, AlpacaModel, Eigenvalues, Period, Frequencies
ra = RunAnalysis(AlpacaModel=assemble_model.AlpacaModel, Settings=analysissettings)  # -> Log, AlpacaModel; disabled
explode_6 = Explode(Object=force_beam_column, Component="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")  # -> Curve, Section, GeomTransf, BeamIntegration, LocalZAxis, Type, Id, INode, JNode, Ndf
panel_3 = Panel(nv_2.Eigenvalues)
nodal_displacement = NodalDisplacementAlpaca4d(AlpacaModel=ra.AlpacaModel, History=False, Step=0)  # -> Displacement, Rotation, port, Velocity, Acceleration
rf = ReactionForceAlpaca4d(AlpacaModel=ra.AlpacaModel, History=False, Step=Slider(0, range=0..12))  # -> SupportPosition, ReactionForce, ReactionMoment
python = GhPythonScript(x=ra.AlpacaModel)  # -> out, a, b
# ---------- python: Python ----------
a = x.Nodes

b = [point.Pos for point in a]
# ---------- end python ----------
sf = ShellForcesAlpaca4d(AlpacaModel=ra.AlpacaModel, History=False, Step=0)  # -> Fx, Fy, Fxy, Mx, My, Mxy, Vxz, Vyz
python_2 = GhPythonScript(x=ra.AlpacaModel)  # -> out, a
# ---------- python_2: Python ----------
__author__ = "MarcoPellegrinoKonsu"
__version__ = "2022.07.10"

import rhinoscriptsyntax as rs

a = x.Shells
# ---------- end python_2 ----------
panel_4 = Panel("100")
python_3 = GhPythonScript(x=python_2.a)  # -> out, a
# ---------- python_3: Python ----------
__author__ = "MarcoPellegrinoKonsu"
__version__ = "2022.07.10"

import rhinoscriptsyntax as rs

a = x.Mesh
# ---------- end python_3 ----------
vdisex = VectorDisplayEx(Point=rf.SupportPosition, Vector=rf.ReactionForce, Colour=RGB(0, 0, 0), Width=2)
demesh_3 = DeconstructMesh(Mesh=python_3.a)  # -> Vertices, Faces, Colours, Normals
multiplication = Multiplication(A=nodal_displacement.Displacement, B=Slider(7107, range=0..10000))
bnd = Bounds(Numbers=flatten(sf.Vxz))
dedomain = DeconstructDomain(Domain=bnd)  # -> Start, End
panel_5 = Panel(sf.Vxz)
abs = Absolute(Value=dedomain.Start)
abs_2 = Absolute(Value=dedomain.End)
move = Move(Geometry=python.b, Motion=multiplication)  # -> Geometry, Transform
max = Maximum(A=abs, B=abs_2)
multiplication_2 = Multiplication(A=max, B=2)
clr = ColorsAlpaca4d(GradientIndex=11)
domcen = CenteredDomain(DomainSize=multiplication_2)
remap = RemapNumbers(Value=sf.Vxz, Source=domcen, Target=Domain(0, 1))  # -> Mapped, Clipped
twnthrucols = TweenThroughColors(
    Colors=clr,
    Factor=remap.Mapped,
    Normalized=True,
    Equalized=False,
    Weighted=False,
    Loopback=False,
    Degree=3,
    InterpolationType=0,
    Alpha=True)
conmesh = ConstructMesh(Vertices=demesh_3.Vertices, Faces=demesh_3.Faces, Colours=twnthrucols)  # -> flatten(Mesh)
mjoin = MeshJoin(Meshes=conmesh)
