# Grasshopper definition GravityLoad.gh (Grasshopper 1.0.7)
# plug-ins: Alpaca4d, Kangaroo2 Components, BH.UI.Grasshopper, MeshEdit Components

vec = VectorXYZ(XComponent="1", YComponent="1", ZComponent="1")  # -> Vector, Length
rectanglehollowcs = RectangleHollowAlpaca4d(Width=0.3, Height=0.6, Web=0.02, TopFlange=0.02, BottomFlange=0.02)
i_section = ISectionAlpaca4d(Height=0.3, TopFlangeWidth=0.15, TopFlangeThickness=0.02, BottomFlangeWidth=0.2, BottomFlangeThickness=0.02, Web=0.02)
pt = Point(Point(0, 0, 0))
rectanglecs = RectangleCSAlpaca4d(Width=0.3, Height=0.6)
circlecs = CircleCSAlpaca4d(Diameter=0.15, Thickness=0.01)
line = LineSDL(Start=pt, Direction=vec.Vector, Length="6")
end = EndPoints(Curve=line)  # -> Start, End
pl = PlaneNormal(Origin=end.End, ZAxis=vec.Vector)

mplane = MeshPlane(Boundary={Plane=PlaneXY(0, 0, 0), Size=Domain2(u=-10..10, v=-10..10)}, WidthCount=10, HeightCount=10)  # -> Mesh, Area
pfs = PlateFiberSectionAlpaca4d()
explode = MeshExplode(Mesh=mplane.Mesh, Interpolate=False)
mc = MeshCorners(Mesh=mplane.Mesh, Angle=2.35619449)
asdq4 = ASDShellQ4Alpaca4d(Mesh=explode, Section=pfs)
support = SupportAlpaca4d(Point=mc, Tx=True, Ty=True, Tz=True, Rx=True, Ry=True, RZ=True)
assemble_model = AssembleModelAlpaca4d(Element=asdq4, Support=support, Tollerance=0.01)  # -> AlpacaModel, MassForce
explode_2 = Explode(Object=asdq4, Component="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")  # -> Id, Mesh, Section, Type, IndexNodes, Ndf, Color
explode_3 = Explode(Object=explode_2.Section, Component="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")  # -> SectionName, Thickness, Material, Id
explode_4 = Explode(Object=explode_3.Material, Component="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")  # -> Id, MatName, E, G, Nu, Rho, MaterialDimension, MaterialType
area = Area(Geometry=explode_2.Mesh)  # -> Area, Centroid
multiplication = Multiplication(A=area.Area, B=explode_3.Thickness, C=explode_4.Rho)
panel = Panel(multiplication)
ma = MassAddition(Input=panel)  # -> Result, PartialResults
panel_2 = Panel(ma.Result)
panel_3 = Panel(assemble_model.MassForce)
equals = Equality(FirstNumber=panel_2, SecondNumber=panel_3)  # -> Equality, Inequality
panel_4 = Panel(equals.Equality)

rectangle = Rectangle(Plane=pl, XSize="20", YSize="20", Radius=0)  # -> Rectangle, Length
end_2 = EndPoints(Curve=line)  # -> Start, End
mplane_2 = MeshPlane(Boundary=rectangle.Rectangle, WidthCount="20", HeightCount="20")  # -> Mesh, Area
pfs_2 = PlateFiberSectionAlpaca4d(Thickness="0.001")
explode_5 = Explode(Curve=line, Recursive=True)  # -> Segments, Vertices
explode_6 = MeshExplode(Mesh=mplane_2.Mesh, Interpolate=False)
force_beam_column = ForceBeamColumnAlpaca4d(Line=line, Section=rectanglecs)
demesh = DeconstructMesh(Mesh=mplane_2.Mesh)  # -> Vertices, Faces, Colours, Normals
mc_2 = MeshCorners(Mesh=mplane_2.Mesh, Angle=2.35619449)
asdq4_2 = ASDShellQ4Alpaca4d(Mesh=explode_6, Section=pfs_2)
demesh_2 = DeconstructMesh()  # -> Vertices, Faces, Colours, Normals
constant_time_series = ConstantTimeSeriesAlpaca4d(LoadFactor=1)  # -> TimeSeries, Graph
Z = UnitZ(Factor="100")
gravity_load = GravityLoadAlpaca4d(TimeSeriesType="Constant", GFactor=1)
X = UnitX(Factor=1)
panel_5 = Panel("200")
Z_2 = UnitZ(Factor=1)
point_load = PointLoadAlpaca4d(Point=demesh.Vertices, Force=Z_2, Moment=Vector(0, 0, 0), TimeSeries=constant_time_series.TimeSeries)
X_2 = UnitX(Factor=1)
explode_7 = Explode(Object=force_beam_column, Component="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")  # -> Curve, Section, GeomTransf, BeamIntegration, LocalZAxis, Type, Id, INode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
meshload = MeshLoadAlpaca4d(MeshElement=asdq4_2, Force=X_2, TimeSeries=constant_time_series.TimeSeries)
explode_8 = Explode(Object=asdq4_2, Component="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")  # -> Id, Mesh, Section, Type, IndexNodes, Ndf, Color
getproperty = GetProperty(Obj=explode_7.Section, PropName="Material", Component="{ .GetProperty")
getproperty_2 = GetProperty(Obj=explode_7.Section, PropName="Area", Component="{ .GetProperty")
explode_9 = Explode(Object=explode_8.Section, Component="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")  # -> SectionName, Thickness, Material, Id
len = Length(Curve=explode_7.Curve)
explode_10 = Explode(Object=getproperty, Component="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")  # -> Id, MatName, E, Eneg, Eta, G, Nu, Rho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
explode_11 = Explode(Object=explode_9.Material, Component="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")  # -> Id, MatName, E, G, Nu, Rho, MaterialDimension, MaterialType
area_2 = MeshArea(Mesh=explode_8.Mesh)  # -> Area, Centroid
multiplication_2 = Multiplication(A=explode_10.Rho, B=getproperty_2, C=len)
multiplication_3 = Multiplication(A=area_2.Area, B=explode_9.Thickness, C=explode_11.Rho)
analysissettings = AnalysisSettingsAlpaca4d(Algorithm="Linear", AnalysisSteps="1")
ma_2 = MassAddition(Input=multiplication_3)  # -> Result, PartialResults
multiplication_4 = Multiplication()

support_2 = SupportAlpaca4d(Point=[end_2.Start, mc_2], Tx=True, Ty=True, Tz=True, Rx=True, Ry=True, RZ=True)
assemble_model_2 = AssembleModelAlpaca4d(Element=flatten([force_beam_column, asdq4_2]), Support=flatten(support_2), Load=flatten(meshload), Tollerance=0.01)  # -> AlpacaModel, MassForce
panel_6 = Panel(assemble_model_2.MassForce)
panel_7 = Panel(multiplication_2)
ma_3 = MassAddition(Input=panel_7)  # -> Result, PartialResults

getproperty_3 = GetProperty(Obj=assemble_model_2.AlpacaModel, PropName="GravityPointLoad", Component="{ .GetProperty")
explode_12 = Explode(Object=getproperty_3, Component="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")  # -> Pos, Force, Moment, Ndf, Type, Id, PatternTag, TimeSeries
modelview = ModelViewAlpaca4d(
    AlpacaModel=assemble_model_2.AlpacaModel,
    Extruded=False,
    Load=Toggle(True),
    LoadFactor=1,
    Support=Toggle(True),
    SupportFactor=1,
    Constraint=False)  # -> AlpacaModel, Info
getproperty_4 = GetProperty(Obj=assemble_model_2.AlpacaModel, PropName="MeshLoad", Component="{ .GetProperty")
ma_4 = MassAddition(Input=explode_12.Force)  # -> Result, PartialResults
panel_8 = Panel(modelview.Info)
addition = Addition(A=ma_2.Result, B=ma_3.Result)
ra = RunAnalysisAlpaca4d(AlpacaModel=assemble_model_2.AlpacaModel, Settings=analysissettings)  # -> Log, AlpacaModel

panel_9 = Panel(addition)
equals_2 = Equality(FirstNumber=panel_9, SecondNumber=panel_6)  # -> Equality, Inequality
panel_10 = Panel(equals_2.Equality)

nd = NodalDisplacementsAlpaca4d(AlpacaModel=ra.AlpacaModel, History=False, Step=0)  # -> Displacement, Rotation, port, Velocity, Acceleration
