# Grasshopper definition oneCantiliver.gh (Grasshopper 1.0.7)
# plug-ins: Alpaca4d, BH.UI.Grasshopper

yz = YZPlane(Origin=Point(0, 0, 0))
xy = XYPlane(Origin=Point(0, 0, 0))
rectangle = Rectangle(Plane=yz, XSize="-5 to 5", YSize="-5 to 5", Radius=0)  # -> Rectangle, Length
mplane = MeshPlane(Boundary=rectangle.Rectangle, WidthCount="2", HeightCount="2")  # -> Mesh, Area
series = Series(Start=0, Step="10", Count="2")
X = UnitX(Factor=series)
vec = VectorXYZ(XComponent="1", YComponent="1", ZComponent="1")  # -> Vector, Length
uniaxial_material_elastic = UniaxialMaterialElasticAlpaca4d(Rho="10000")
pt = Point(Point(0, 0, 0))
X_2 = UnitX(Factor=1)
Z = UnitZ(Factor=1)
move = Move(Geometry=mplane.Mesh, Motion=X)  # -> Geometry, Transform
line = LineSDL(Start=pt, Direction=X_2, Length="6")
circlecs = CircleCSAlpaca4d(Diameter="10.0", Material=uniaxial_material_elastic)
circlecs_2 = CircleCSAlpaca4d(Diameter=0.15, Thickness=0.01)
divide = DivideCurve(Curve=line, Count="2", Kinks=False)  # -> Points, Tangents, Parameters
pline = PolyLine(Vertices=divide.Points, Closed=False)
rectanglecs = RectangleCSAlpaca4d(Width=0.3, Height=0.6)
explode = Explode(Curve=pline, Recursive=True)  # -> flatten(Segments), Vertices
license = LicenseAlpaca4d()
end = EndPoints(Curve=line)  # -> Start, End
Y = UnitY(Factor="10000")
flip = FlipCurve(Curve=explode.Segments)  # -> Curve, Flag
constant_time_series = ConstantTimeSeriesAlpaca4d(LoadFactor=1)  # -> TimeSeries, Graph
force_beam_column = ForceBeamColumnAlpaca4d(Line=flip.Curve, Section=rectanglecs)
vec_2 = VectorXYZ(XComponent="0", YComponent="0", ZComponent="0")  # -> Vector, Length
item = ListItem(List=force_beam_column, Index=0, Wrap=True)
support = SupportAlpaca4d(Point=end.Start, Tx=True, Ty=True, Tz=True, Rx=True, Ry=True, RZ=True)
mp = MassPointAlpaca4d(Point=end.End, TransMass=vec_2.Vector, RotationalMass=Vector(0, 0, 0))
constant_time_series_2 = ConstantTimeSeriesAlpaca4d(LoadFactor=1)  # -> TimeSeries, Graph
point_load = PointLoadAlpaca4d(Point=end.End, Force=Y, Moment=Vector(0, 0, 0), TimeSeries=constant_time_series_2.TimeSeries)
X_3 = UnitX(Factor="10000")
panel = Panel("-2")
list = ValueList({"NormUnbalance", "NormDispIncr", "EnergyIncr", "RelativeNormUnbalance", "RelativeNormDispIncr", "RelativeTotalNormDispIncr", "RelativeEnergyIncr", "FixedNumIter"}, selected="NormUnbalance")
list_2 = ValueList({"NormUnbalance", "NormDispIncr", "EnergyIncr", "RelativeNormUnbalance", "RelativeNormDispIncr", "RelativeTotalNormDispIncr", "RelativeEnergyIncr", "FixedNumIter"}, selected="EnergyIncr")
list_3 = ValueList({"NormUnbalance", "NormDispIncr", "EnergyIncr", "RelativeNormUnbalance", "RelativeNormDispIncr", "RelativeTotalNormDispIncr", "RelativeEnergyIncr", "FixedNumIter"}, selected="NormDispIncr")
Y_2 = UnitY(Factor="10000")
Z_2 = UnitZ(Factor=1)
vec_3 = VectorXYZ(XComponent="1", YComponent="1", ZComponent="1")  # -> Vector, Length
list_4 = ValueList({"Linear", "Newton", "NewtonLineSearch", "ModifiedNewton", "KrylovNewton", "SecantNewton", "BFGS", "Broyden"}, selected="Linear")
list_5 = ValueList({"Plain", "Transformation"}, selected="Transformation")
explode_2 = Explode(Object=force_beam_column, Component="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")  # -> Curve, Section, GeomTransf, BeamIntegration, LocalZAxis, Type, Id, INode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
list_6 = ValueList({"RCM", "AMD", "Plain", "ParallelPlain", "ParallelRCM"}, selected="RCM")
list_7 = ValueList({"BandGen", "BandSPD", "ProfileSPD", "SuperLU", "UmfPack", "FullGeneral", "SparseSYM"}, selected="BandGen")
list_8 = ValueList({"Static", "Transient"}, selected="Static")
rev = Reverse(Vector=vec_3.Vector)
list_9 = ValueList({"One": 1, "Two": 2, "Three": 2² - 1, "Four": Sqrt(16)}, selected="One")
linearload = LinearLoadAlpaca4d(BeamElement=item, Force=X_3, TimeSeries=constant_time_series_2.TimeSeries)
merge = Merge(Data1=flatten(mp), Data2=flatten(linearload))  # -> flatten(Result)
assemble_model = AssembleModelAlpaca4d(Element=flatten(force_beam_column), Support=support, Load=flatten(merge), Tollerance=0.01)  # -> AlpacaModel, Tcl
linearload_2 = LinearLoadAlpaca4d()
test = TestAlpaca4d(TestType=list_3, Tollerance=1e-08, Iteration=10, Flag=0, Norm=2)
analysissettings = AnalysisSettingsAlpaca4d(Constraint=list_5, Numberer=list_6, System=list_7, Algorithm=list_4, AnalysisType=list_8, AnalysisSteps="1")
python = GhPythonScript(x=assemble_model.AlpacaModel)  # -> out, a, b
# ---------- python: Python ----------
__author__ = "MarcoPellegrinoKonsu"
__version__ = "2022.07.30"

import rhinoscriptsyntax as rs

a =  x.UniquePointsSixNDF
b = x.UniquePointsThreeNDF
# ---------- end python ----------
panel_2 = Panel(test)
explode_3 = Explode(Object=explode_2.GeomTransf, Component="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")  # -> Type, Line, Id, LocalZ, LocalY
explode_4 = Explode(Object=linearload, Component="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")  # -> Id, Range, AllElements, Element, GlobalForce, LocalForce, Ndf, Type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
panel_3 = Panel(explode_4.GlobalForce)
threendf = Geometry(python.b)
sixndf = Geometry(python.a)
midpt = CurveMiddle(Curve=explode_3.Line)
explode_5 = Explode(Object=analysissettings, Component="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")  # -> Constraint, Numberer, SystemEquation, Test, Algorithm, Integrator, Analysis, AnalysisStep, Damping
ra = RunAnalysisAlpaca4d(AlpacaModel=assemble_model.AlpacaModel, Settings=analysissettings)  # -> Log, AlpacaModel
panel_4 = Panel(assemble_model.Tcl)
pl = ConstructPlane(Origin=midpt, XAxis=explode_3.LocalZ, YAxis=explode_3.LocalY)
model_view_alpaca4d = ModelViewAlpaca4d(
    AlpacaModel=assemble_model.AlpacaModel,
    Extruded=Toggle(True),
    Load=Toggle(True),
    LoadFactor=1,
    Support=False,
    SupportFactor=1,
    Constraint=False)  # -> AlpacaModel, Info
explode_6 = Explode(Object=explode_5.Algorithm, Component="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")
item_2 = ListItem(List=pl, Index="-1", Wrap=True)
pt_2 = Point(Point(0, 0, 0))
panel_6 = Panel(explode_4.LocalForce)
vec_4 = VectorXYZ(XComponent="10", YComponent="10", ZComponent="10")  # -> Vector, Length
pl_origin = PlaneOrigin(Base=item_2, Origin=pt_2)
pt_3 = Point(vec_4.Vector)
deplane = DeconstructPlane(Plane=pl_origin)  # -> Origin, XAxis, YAxis, ZAxis
python_2 = GhPythonScript(x=ra.AlpacaModel)  # -> out, a
# ---------- python_2: Python ----------
a = x.Tcl
# ---------- end python_2 ----------
nd = NodalDisplacementsAlpaca4d(AlpacaModel=ra.AlpacaModel, History=False, Step=0)  # -> Displacement, Rotation, port, Velocity, Acceleration
rf = ReactionForcesAlpaca4d(AlpacaModel=ra.AlpacaModel, History=False, Step=0)  # -> SupportPosition, ReactionForce, ReactionMoment
projecta = ProjectAlong(Geometry=pt_3, Plane=pl_origin, Direction=deplane.ZAxis)  # -> Geometry, Transform
python_3 = GhPythonScript(x=ra.AlpacaModel)  # -> out, a
# ---------- python_3: Python ----------
__author__ = "MarcoPellegrinoKonsu"
__version__ = "2022.07.29"

import rhinoscriptsyntax as rs

a = x.UniquePoints
# ---------- end python_3 ----------
vdis = VectorDisplay(Anchor=deplane.Origin, Vector=deplane.ZAxis)
python_4 = GhPythonScript(X=pt_3)  # -> Out, A
plcoord = PlaneCoordinates(Point=pt_3, System=pl_origin)  # -> XCoordinate, YCoordinate, ZCoordinate
number_slider = Slider(0, range=0..2)
unit = UnitVector(Vector=rf.ReactionForce)
multiplication = Multiplication(A=nd.Displacement, B="10")
vdisex = VectorDisplayEx(Point=rf.SupportPosition, Vector=unit, Colour=RGB(0, 0, 0), Width=2)
devec = DeconstructVector(Vector=nd.Displacement)  # -> XComponent, YComponent, ZComponent
vlen = VectorLength(Vector=nd.Displacement)
move_2 = Move(Geometry=python_3.a, Motion=multiplication)  # -> Geometry, Transform
entwine = Entwine(Branch00=devec.XComponent, Branch01=devec.YComponent, Branch02=devec.ZComponent, FlattenInputs=True)
bnd = Bounds(Numbers=entwine)
panel_7 = Panel(bnd)
