# Grasshopper definition MeshLoad.gh (Grasshopper 1.0.7)
# plug-ins: Alpaca4d, Kangaroo2 Components, MeshEdit Components, BH.UI.Grasshopper

eim = ElasticIsotropicMaterialAlpaca4d()
explode = Explode(Object=eim, Component="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")  # -> Id, MatName, E, G, Nu, Rho, MaterialDimension, MaterialType
explode_2 = Explode(Object=eim, Component="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")  # -> Id, MatName, E, G, Nu, Rho, MaterialDimension, MaterialType
mplane = MeshPlane(Boundary={Plane=PlaneXY(0, 0, 0), Size=Domain2(u=-10..10, v=-10..10)}, WidthCount="20", HeightCount="20")  # -> Mesh, Area
demesh = DeconstructMesh(Mesh=mplane.Mesh)  # -> Vertices, Faces, Colours, Normals
fs = FiberSectionAlpaca4d(Thickness="0.30", Material=eim)
mc = MeshCorners(Mesh=mplane.Mesh, Angle=2.35619449)
explode_3 = MeshExplode(Mesh=mplane.Mesh, Interpolate=False)
constant_time_series = ConstantTimeSeriesAlpaca4d(LoadFactor=1)  # -> TimeSeries, Graph
item = ListItem(List=mc, Index=0, Wrap=True)  # -> Item, Item1, Item2, Item3
line = LineSDL(Start=demesh.Vertices, Direction=Vector(0, 0, 1), Length="5")
constant_time_series_2 = ConstantTimeSeriesAlpaca4d(LoadFactor="10")  # -> TimeSeries, Graph
Z = UnitZ(Factor="1")
vec = VectorXYZ(XComponent=0, YComponent=0, ZComponent="100")  # -> Vector, Length
asdq4 = ASDShellQ4Alpaca4d(Mesh=explode_3, Section=fs, Colour=ColourSwatch(SwatchColor=RGB(115, 87, 87)))
lng = ListLength(List=demesh.Vertices)
toggle = BooleanToggle(False)
toggle_2 = BooleanToggle(False)
jitter = Jitter(List=line, Jitter=1, Seed=2)  # -> Values, Indices
random = Random(Range="1 to 200", Number=lng, Seed=2)
gravity_load = GravityLoadAlpaca4d(TimeSeries=constant_time_series_2.TimeSeries)
circlecs = CircleCSAlpaca4d(Diameter=0.15, Thickness=0.01)
meshload = MeshLoadAlpaca4d(Force=vec.Vector, TimeSeries=constant_time_series.TimeSeries)
constant_time_series_3 = ConstantTimeSeriesAlpaca4d(LoadFactor=1)  # -> TimeSeries, Graph
gravity_load_2 = GravityLoadAlpaca4d(TimeSeriesType="Constant", GFactor=1)
support = SupportAlpaca4d(Point=item.Item, Tx=True, Ty=True, Tz=True, Rx=True, Ry=True, RZ=True)
support_2 = SupportAlpaca4d(Point=item.Item1, Tx=True, Ty=True, Tz=Toggle(False), Rx=Toggle(True), Ry=True, RZ=True)
Z_2 = UnitZ(Factor="-20")
support_3 = SupportAlpaca4d(Point=item.Item3, Tx=True, Ty=True, Tz=Toggle(True), Rx=toggle, Ry=toggle, RZ=toggle)
split = SplitList(List=jitter.Values, Index="10")  # -> ListA, ListB
item_2 = ListItem(List=demesh.Vertices, Index=0, Wrap=True)
support_4 = SupportAlpaca4d(Point=item.Item2, Tx=True, Ty=toggle_2, Tz=True, Rx=toggle_2, Ry=True, RZ=True)
explode_4 = Explode(Object=gravity_load, Component="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")  # -> Type, TimeSeries
constant_time_series_4 = ConstantTimeSeriesAlpaca4d(LoadFactor=1)  # -> TimeSeries, Graph
end = EndPoints(Curve=split.ListA)  # -> Start, End
support_5 = SupportAlpaca4d(Point=mc, Tx=True, Ty=True, Tz=True, Rx=True, Ry=True, RZ=True)
point_load = PointLoadAlpaca4d(Point=item_2, Force=Z_2, Moment=Vector(0, 0, 0), TimeSeries=constant_time_series.TimeSeries)
data = Data(flatten(support_5))
X = UnitX(Factor=1)
Y = UnitY(Factor="0")
force_beam_column = ForceBeamColumnAlpaca4d(Line=split.ListA, Section=circlecs)
Z_3 = UnitZ(Factor="0")
linearload = LinearLoadAlpaca4d(Force=X, TimeSeries=constant_time_series_3.TimeSeries)
list = ValueList({"Linear", "Newton", "NewtonLineSearch", "ModifiedNewton", "KrylovNewton", "SecantNewton", "BFGS", "Broyden"}, selected="Linear")
point_load_2 = PointLoadAlpaca4d(Point=end.End, Force=Z_3, Moment=Vector(0, 0, 0), TimeSeries=constant_time_series_4.TimeSeries)
assemble_model = AssembleModelAlpaca4d(Element=flatten([asdq4, force_beam_column]), Support=data, Load=flatten([gravity_load_2, point_load_2]), Tollerance=0.01)  # -> AlpacaModel, MassForce
panel = Panel(assemble_model.MassForce)
analysissettings = AnalysisSettingsAlpaca4d(Algorithm=list, AnalysisSteps="5")
ra = RunAnalysisAlpaca4d(AlpacaModel=assemble_model.AlpacaModel, Settings=analysissettings)  # -> Log, AlpacaModel
panel_2 = Panel(ra.Log)
number_slider = Slider(1.53, range=0..5)
modelview = ModelViewAlpaca4d(AlpacaModel=ra.AlpacaModel, Extruded=False, Load=False, LoadFactor=1, Support=False, SupportFactor=1, Constraint=False)  # -> AlpacaModel, Info
data_2 = Data(assemble_model.AlpacaModel)
nv = NaturalVibrationAnalysisAlpaca4d(AlpacaModel=assemble_model.AlpacaModel, VibrationModes=1, Solver="-fullGenLapack")  # -> Log, AlpacaModel, Eigenvalues, Period, Frequencies; disabled
rf = ReactionForcesAlpaca4d(AlpacaModel=ra.AlpacaModel, History=False, Step=0)  # -> SupportPosition, ReactionForce, ReactionMoment
panel_3 = Panel(modelview.Info)
nd = NodalDisplacementsAlpaca4d(AlpacaModel=ra.AlpacaModel, History=False, Step=0)  # -> Displacement, Rotation, port, Velocity, Acceleration
modelview_2 = ModelViewAlpaca4d(
    AlpacaModel=data_2,
    Extruded=Toggle(False),
    Load=Toggle(False),
    LoadFactor=number_slider,
    Support=Toggle(True),
    SupportFactor=number_slider,
    Constraint=Slider(2.27, range=0..5))  # -> AlpacaModel, Info
python = GhPythonScript(x=ra.AlpacaModel)  # -> out, a
# ---------- python: Python ----------
__author__ = "MarcoPellegrinoKonsu"
__version__ = "2022.08.07"

import rhinoscriptsyntax as rs

a = x.UniquePoints
# ---------- end python ----------
mar = ModalAnalysisReportAlpaca4d(AlpacaModel=nv.AlpacaModel)  # -> EigenValueAnalysis, TotalMassOfStructure, TotalFreeMass, CenterOfMass, ModalParticipationFactors, ModalParticipationMasses, ModalParticipationMasses_Cumulative, ModalParticipationMassesRatio, ModalParticipationMassesRatio_Cumulative; disabled
number_slider_2 = Slider(10, range=1..10)
number_slider_3 = Slider(1, range=1..100000)
panel_4 = Panel("1")
clr = ColorsAlpaca4d(GradientIndex=Slider(2, range=0..12))
vdisex = VectorDisplayEx(Point=rf.SupportPosition, Vector=rf.ReactionForce, Colour=RGB(0, 0, 0), Width=2)
panel_5 = Panel("1000")
vlen = VectorLength(Vector=nd.Displacement)
panel_6 = Panel(modelview_2.Info)
panel_7 = Panel("0")
sort = SortList(Keys=vlen)  # -> Keys, ValuesA
c_script = CSharpScript(x=ra.AlpacaModel, y=number_slider_2, Reference="C:\GitHub\OpenSeesGh\Alpaca.Core\bin\Debug\Alpaca.Core.dll")  # -> out, A; inputs y: Double
# ---------- c_script: C# usings ----------
using Alpaca4d;
# ---------- c_script: C# ----------
    var model = (Alpaca4d.Model) x;

    var disp = model.DeformedBeam(1, y);
    A = disp;
# ---------- end c_script ----------
item_3 = ListItem(List=reverse(sort.Keys), Index=0, Wrap=True)
legend = Legend(Colour=clr, Tags=["One Fish", "Two Fish", "Red Fish", "Blue Fish"], LegendType=1)
deformed_model_view = DeformedModelViewAlpaca4d(AlpacaModel=ra.AlpacaModel, Step=0, Scale=number_slider_2, Colors=clr)  # -> Line, Mesh
division = Division(A=nd.Displacement, B=item_3)
mjoin = MeshJoin(Meshes=deformed_model_view.Mesh)
multiplication = Multiplication(A=division, B=Slider(3.464, range=1..10))
move = Move(Geometry=python.a, Motion=multiplication)  # -> Geometry, Transform
license = LicenseAlpaca4d()
slrz = SerializeAlpaca4d(AlpacaModel=ra.AlpacaModel, Save=True)
dslrz = DeserialiseAlpaca4d()  # -> Points, Lines, ShellMesh, BrickMesh
panel_8 = Panel(license)
