# Grasshopper definition PortalFrame.gh (Grasshopper 1.0.7)
# plug-ins: Alpaca4d, BH.UI.Grasshopper, Kangaroo2 Components, Pufferfish, Karamba3D, Wombat

Y = UnitY(Factor=1)
pt = Point(Point(0, 0, 0))
X = UnitX(Factor=1)
genes = GenePool(Decimals=2, Maximum=1, Minimum=0, Value=[0, 0.67])
uniaxial_material_elastic = UniaxialMaterialElasticAlpaca4d()
line = LineSDL(Start=pt, Direction=X, Length="500")
shatter = Shatter(Curve=reparameterize(line), Parameters=genes)
matprops = MaterialPropertiesKaramba3D(
    FamilyOfMaterial="Steel",
    Name="S235",
    YoungsModulus_kN_cm2=21000,
    InPlaneShearModulus_kN_cm2=8076,
    TransverseShearModulus_kN_cm2=8076,
    SpecificWeight_kN_m3=78.5,
    CoefficientOfThermalExpansion_1_C=1.2e-05,
    TensileStrength_kN_cm2=23.5,
    CompressiveStrength_kN_cm2=-23.5,
    StrengthHypothesis="MISES",
    mode="Isotrop")
crv = Curve(<curve referenced from the Rhino model>)
explode = Explode(Curve=crv, Recursive=True)  # -> Segments, Vertices
divide_target = DivideByTargetLength(Curve=explode.Segments, Length="50")  # -> Points, Tangents, Parameters
uniaxial_material_elastic_2 = UniaxialMaterialElasticAlpaca4d(MaterialName="myMaterial", E="21000", Eneg="21000", Eta="0.3", G="8000", V="0.3", Rho="7850")
circlecs = CircleCSAlpaca4d(SectionName="mySection", Diameter="22", Thickness="0.1", Material=uniaxial_material_elastic_2)
pline = PolyLine(Vertices=divide_target.Points, Closed=False)
panel = Panel("200")
panel_2 = Panel("100")
explode_2 = Explode(Curve=pline, Recursive=True)  # -> Segments, Vertices
Z = UnitZ(Factor=1)
circlecs_2 = CircleCSAlpaca4d(SectionName="mySection", Diameter="20", Thickness="0.2", Material=uniaxial_material_elastic_2)
duppt = RemoveDuplicatePts(Points=flatten(explode_2.Vertices), Tolerance=0.01)
move = Move(Geometry=explode_2.Segments, Motion=Z)  # -> Geometry, Transform
duppt_2 = RemoveDuplicatePts(Points=flatten(explode_2.Vertices), Tolerance=0.01)
lng = ListLength(List=duppt)
panel_3 = Panel(circlecs_2)
explode_3 = Explode(Recursive=True)  # -> Segments, Vertices
series = Series(Start=0, Step=1, Count=lng)
item = ListItem(List=explode_2.Vertices, Index="3", Wrap=True)
dupln = RemoveDuplicateLines(Lines=flatten(explode_2.Segments), Tolerance=0.01)
panel_4 = Panel(series)
constant_time_series = ConstantTimeSeriesAlpaca4d(ConstantFactor="1")  # -> TimeSeries, Graph
linear_time_series = LinearTimeSeriesAlpaca4d(LinearFactor="1")  # -> TimeSeries, Graph
end = EndPoints(Curve=crv)  # -> Start, End
X_2 = UnitX(Factor=1)
duppt_3 = RemoveDuplicatePts(Points=flatten(item), Tolerance=0.01)
eval = EvaluateCurve(Curve=reparameterize(line), Parameter=genes)  # -> Point, Tangent, Angle
x_plus_one = XPlusOne()
Z_2 = UnitZ(Factor=1)
Z_3 = UnitZ(Factor="-200")
X_3 = UnitX(Factor=1)
Z_4 = UnitZ(Factor=1)
explode_4 = Explode(Object=constant_time_series.TimeSeries, Component="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")  # -> Type, CFactor, Id
Y_2 = UnitY(Factor=1)
vec = VectorXYZ(XComponent=0, YComponent="0.20", ZComponent="0.20")  # -> Vector, Length
force_beam_column = ForceBeamColumnAlpaca4d(Line=dupln, Section=circlecs_2, ZAxis=Y_2)
mp = MassPoint(Point=duppt, TransMass=Z_4, RotationalMass=Vector(0, 0, 0))
point_load = PointLoadAlpaca4d(Point=duppt, Force=X_2, Moment=Vector(0, 0, 0), TimeSeries=linear_time_series.TimeSeries)
support = SupportAlpaca4d(Point=[end.Start, end.End], Tx=Toggle(True), Ty=True, Tz=True, Rx=True, Ry=True, RZ=True)
explode_5 = Explode(Object=force_beam_column, Component="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")  # -> Curve, Section, GeomTransf, BeamIntegration, LocalZAxis, Type, Id, INode, JNode, Ndf
data = Data(flatten(force_beam_column))
merge = Merge(Data1=point_load, Data2=mp)
explode_6 = Explode(Object=explode_5.GeomTransf, Component="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")  # -> Type, Line, Id, ZAxis, RefVector
crv_2 = Curve(explode_6.Line)
assemble_model = AssembleModelAlpaca4d(Element=flatten(data), Support=flatten(support), Load=flatten(merge), Tollerance=0.01)  # -> AlpacaModel, Tcl
analysisstep = AnalysisStepAlpaca4d(NumIncr="20")
multiplication = Multiplication(A=explode_6.ZAxis, B="100")
multiplication_2 = Multiplication(A=explode_6.RefVector, B="100")
midpt = CurveMiddle(Curve=explode_6.Line)
vdisex = VectorDisplayEx(Point=midpt, Vector=multiplication_2, Colour=ColourSwatch(SwatchColor=RGB(51, 0, 204)), Width=2)
analysissettings = AnalysisSettingsAlpaca4d(AnalysisSteps=analysisstep)
vdisex_2 = VectorDisplayEx(Point=midpt, Vector=multiplication, Colour=ColourSwatch(SwatchColor=RGB(92, 204, 0)), Width=2)
ra = RunAnalysis(AlpacaModel=assemble_model.AlpacaModel, Settings=analysissettings)
analysissettings_2 = AnalysisSettingsAlpaca4d()
data_2 = Data(ra)
nodal_displacement = NodalDisplacementAlpaca4d(AlpacaModel=data_2, History=False, Step=Slider(0, range=0..5))  # -> Displacement, Rotation, port, Velocity, Acceleration
python = GhPythonScript(x=ra)  # -> out, a, b, c
# ---------- python: Python ----------
a = x.Recorders
b = x.Tcl

c = x.Nodes

x.Nodes
# ---------- end python ----------
python_2 = GhPythonScript(x=ra)  # -> out, a, b
# ---------- python_2: Python ----------
a = x.Recorders
b = x.Tcl
# ---------- end python_2 ----------
vlen = VectorLength(Vector=nodal_displacement.Displacement)
explode_7 = Explode(Object=python.c, Component="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")  # -> Pos, Id, Ndf, Mass
sort = SortList(Keys=vlen)  # -> Keys, ValuesA
panel_5 = Panel("10000")
panel_6 = Panel(python_2.b)
item_2 = ListItem(List=reverse(sort.Keys), Index=0, Wrap=True)
panel_7 = Panel(item_2)
multiplication_3 = Multiplication(A=nodal_displacement.Displacement, B=Slider(3, range=1..100))
move_2 = Move(Geometry=explode_7.Pos, Motion=multiplication_3)  # -> Geometry, Transform
pline_2 = PolyLine(Vertices=move_2.Geometry, Closed=False)
