# Grasshopper definition ShellNLDKGT.gh (Grasshopper 1.0.7)
# plug-ins: MeshEdit Components, Alpaca4d, Kangaroo2 Components, BH.UI.Grasshopper

mplane = MeshPlane(Boundary={Plane=PlaneXY(0, 0, 0), Size=Domain2(u=-10..10, v=-10..10)}, WidthCount=10, HeightCount=10)  # -> Mesh, Area
explode = MeshExplode(Mesh=mplane.Mesh, Interpolate=False)
jitter = Jitter(List=explode, Jitter=1, Seed=2)  # -> Values, Indices
explode_2 = MeshExplode(Mesh=jitter.Values, Interpolate=False)  # -> flatten(Faces)
split = SplitList(List=explode_2, Index="20")  # -> ListA, ListB
mjoin = MeshJoin(Meshes=split.ListA)
tri = Triangulate(Mesh=split.ListB)  # -> Mesh, Count
mjoin_2 = MeshJoin(Meshes=tri.Mesh)
pfs = PlateFiberSectionAlpaca4d()
constant_time_series = ConstantTimeSeriesAlpaca4d(LoadFactor=1)  # -> TimeSeries, Graph
mc = MeshCorners(Mesh=mplane.Mesh, Angle=2.35619449)
Z = UnitZ(Factor=1)
demesh = DeconstructMesh(Mesh=mplane.Mesh)  # -> Vertices, Faces, Colours, Normals
asdq4 = ASDShellQ4Alpaca4d(Mesh=mjoin_2, Section=pfs)  # -> flatten(Element)
point_load = PointLoadAlpaca4d(Point=demesh.Vertices, Force=Z, Moment=Vector(0, 0, 0), TimeSeries=constant_time_series.TimeSeries)
support = SupportAlpaca4d(Point=mc, Tx=True, Ty=True, Tz=True, Rx=True, Ry=True, RZ=True)
asdq4_2 = ASDShellQ4Alpaca4d(Mesh=mjoin, Section=pfs)  # -> flatten(Element)
assemble_model = AssembleModelAlpaca4d(Element=flatten([asdq4_2, asdq4]), Support=support, Load=point_load, Tollerance=0.01)  # -> AlpacaModel, MassForce
list = ValueList({"Static", "Transient"}, selected="Static")
analysissettings = AnalysisSettingsAlpaca4d(AnalysisType=list, AnalysisSteps="10")
getproperty = GetProperty(Obj=assemble_model.AlpacaModel, PropName="Shells", Component="{ .GetProperty")

# ---- group: Run Analysis (Alpaca4d)
ra = RunAnalysisAlpaca4d(AlpacaModel=assemble_model.AlpacaModel, Settings=analysissettings)  # -> Log, AlpacaModel

# ----
explode_3 = Explode(Object=getproperty, Component="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")  # -> Id, Mesh, Section, Type, IndexNodes, Ndf, Color, ElementClass, IsNonLinear
nd = NodalDisplacementsAlpaca4d(AlpacaModel=ra.AlpacaModel, History=False, Step=0)  # -> Displacement, Rotation, port, Velocity, Acceleration
modelview = ModelViewAlpaca4d(AlpacaModel=ra.AlpacaModel, Extruded=False, Load=False, LoadFactor=1, Support=False, SupportFactor=1, Constraint=False)  # -> AlpacaModel, Info
ss = ShellStressesAlpaca4d(AlpacaModel=ra.AlpacaModel, History=False, Step=0)  # -> Pxx, Pyy, Pxy, Mxx, Myy, Mxy, Vxz, Vyz
deformed_model_view = DeformedModelViewAlpaca4d(AlpacaModel=ra.AlpacaModel, Step=0, Scale=1)  # -> Line, Mesh, Brick
panel = Panel(modelview.Info)
panel_2 = Panel(ss.Mxx)
