# Grasshopper definition MeshTimeHistory.gh (Grasshopper 1.0.7)
# plug-ins: Alpaca4d, Kangaroo2 Components, MeshEdit Components, BH.UI.Grasshopper

mplane = MeshPlane(Boundary={Plane=PlaneXY(0, 0, 0), Size=Domain2(u=-10..10, v=-10..10)}, WidthCount=10, HeightCount=10)  # -> Mesh, Area
fs = FiberSectionAlpaca4d(Thickness="0.3")
explode = MeshExplode(Mesh=mplane.Mesh, Interpolate=False)
range = Range(Domain="0 to 5", Steps="100")
lng = ListLength(List=range)
asdq4 = ASDShellQ4Alpaca4d(Mesh=explode, Section=fs)
constant_time_series = ConstantTimeSeriesAlpaca4d(LoadFactor=1)  # -> TimeSeries, Graph
random = Random(Range="0 to 1.00", Number=lng, Seed=2)
mc = MeshCorners(Mesh=mplane.Mesh, Angle=2.35619449)
support = SupportAlpaca4d(Point=mc, Tx=True, Ty=True, Tz=True, Rx=True, Ry=True, RZ=True)
Z = UnitZ(Factor="100")
pts = PathTimeSeriesAlpaca4d(Times=range, Values=random, LoadFactor="1")  # -> TimeSeries, Graph
circlecs = CircleCSAlpaca4d(Diameter=0.15, Thickness=0.01)
constant_time_series_2 = ConstantTimeSeriesAlpaca4d(LoadFactor=1)  # -> TimeSeries, Graph
item = ListItem(List=asdq4, Index=0, Wrap=True)
meshload = MeshLoadAlpaca4d(Force=Z, TimeSeries=pts.TimeSeries)
line = LineSDL(Direction=Vector(0, 0, 1), Length=1)
graph = QuickGraph(pts.Graph, SortOrder=0)
tts = TrigonometricTimeSeriesAlpaca4d(TStart=0, TEnd="5", Period="2", Shift=0, LoadFactor=1)  # -> TimeSeries, Graph
assemble_model = AssembleModelAlpaca4d(Element=asdq4, Support=support, Load=flatten(meshload), Tollerance=0.01)  # -> AlpacaModel, Tcl
explode_2 = Explode(Object=pts.TimeSeries, Component="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")  # -> Id, Type, CFactor, Times, Values
force_beam_column = ForceBeamColumnAlpaca4d(Line=line, Section=circlecs)
X = UnitX(Factor=1)
panel = Panel([explode_2.Type, explode_2.CFactor, explode_2.Times, explode_2.Values])
analysisstep = AnalysisStepAlpaca4d(NumIncr="100", Dt="0.05")
list = ValueList({"Static", "Transient"}, selected="Transient")
nm = IntegratorNewmarkAlpaca4d(Gamma=0.5, Beta=0.25)
linearload = LinearLoadAlpaca4d(Force=X, TimeSeries=constant_time_series_2.TimeSeries)
analysissettings = AnalysisSettingsAlpaca4d(Integrator=nm, AnalysisType=list, AnalysisSteps=analysisstep)
nv = NaturalVibrationAnalysisAlpaca4d(AlpacaModel=assemble_model.AlpacaModel, VibrationModes=1, Solver="-fullGenLapack")  # -> Log, AlpacaModel, Eigenvalues, Period, Frequencies; disabled
ra = RunAnalysisAlpaca4d(AlpacaModel=assemble_model.AlpacaModel, Settings=analysissettings)  # -> Log, AlpacaModel
mar = ModalAnalysisReportAlpaca4d(AlpacaModel=nv.AlpacaModel)  # -> EigenValueAnalysis, TotalMassOfStructure, TotalFreeMass, CenterOfMass, ModalParticipationFactors, ModalParticipationMasses, ModalParticipationMasses_Cumulative, ModalParticipationMassesRatio, ModalParticipationMassesRatio_Cumulative; disabled
python = GhPythonScript(x=ra.AlpacaModel)  # -> out, a
# ---------- python: Python ----------
__author__ = "MarcoPellegrinoKonsu"
__version__ = "2022.08.26"

import rhinoscriptsyntax as rs

a = x.Tcl
# ---------- end python ----------
panel_2 = Panel(python.a)
number_slider = Slider(999, range=0..999)
number_slider_2 = Slider(0, range=0..100)
number_slider_3 = Slider(85, range=0..99)
panel_3 = Panel(ra.Log)
rf = ReactionForcesAlpaca4d(AlpacaModel=ra.AlpacaModel, History=False, Step=0)  # -> SupportPosition, ReactionForce, ReactionMoment
nd = NodalDisplacementsAlpaca4d(AlpacaModel=ra.AlpacaModel, History=Toggle(False), Step=Slider(99, range=0..99))  # -> Displacement, Rotation, port, Velocity, Acceleration
python_2 = GhPythonScript(x=ra.AlpacaModel)  # -> out, a
# ---------- python_2: Python ----------
__author__ = "MarcoPellegrinoKonsu"
__version__ = "2022.08.07"

import rhinoscriptsyntax as rs

a = x.UniquePoints
# ---------- end python_2 ----------
vdisex = VectorDisplayEx(Point=rf.SupportPosition, Vector=rf.ReactionForce, Colour=RGB(0, 0, 0), Width=2)
vlen = VectorLength(Vector=nd.Displacement)
bnd = Bounds(Numbers=vlen)
multiplication = Multiplication(A=nd.Displacement, B=Slider(3366, range=1..100000))
panel_4 = Panel(bnd)
move = Move(Geometry=python_2.a, Motion=multiplication)  # -> Geometry, Transform
