# Grasshopper definition localToGlobal.gh (Grasshopper 1.0.7)
# plug-ins: Alpaca4d

vec = VectorXYZ(XComponent=Slider(0.47, range=0..1), YComponent=Slider(0.93, range=0..1), ZComponent=Slider(1, range=0..1))  # -> Vector, Length
python = GhPythonScript(x=vec.Vector)  # -> out, a; inputs x: Vector3d
# ---------- python: Python ----------
import Rhino.Geometry as rg
import copy

transf = rg.Transform.PlaneToPlane(rg.Plane.WorldXY, rg.Plane.WorldZX)

newVector = copy.deepcopy(x)
newVector.Transform(transf)

a = newVector
# ---------- end python ----------
linearload = LinearLoadAlpaca4d()
panel = Panel(python.a)
