# Grasshopper definition HexBrick.gh (Grasshopper 1.0.7)
# plug-ins: Alpaca4d, BH.UI.Grasshopper

yz = YZPlane(Origin=Point(0, 0, 0))
xy = XYPlane(Origin=Point(0, 0, 0))
rectangle = Rectangle(Plane=yz, XSize="-5 to 5", YSize="-5 to 5", Radius=0)  # -> Rectangle, Length
mplane = MeshPlane(Boundary=rectangle.Rectangle, WidthCount="2", HeightCount="2")  # -> Mesh, Area
series = Series(Start=0, Step="10", Count="2")
X = UnitX(Factor=series)
move = Move(Geometry=mplane.Mesh, Motion=X)  # -> Geometry, Transform
item = ListItem(List=move.Geometry, Index=0, Wrap=True)  # -> Item1, Item, Item1_2
demesh = DeconstructMesh(Mesh=item.Item1)  # -> Vertices, Faces, Colours, Normals
demesh_2 = DeconstructMesh(Mesh=item.Item)  # -> Vertices, Faces, Colours, Normals
circlecs = CircleCSAlpaca4d()
mstb = MeshSeriesToBrickAlpaca4d(Meshes=move.Geometry, Closed=Toggle(False))
eim = ElasticIsotropicMaterialAlpaca4d()
item_2 = ListItem(List=move.Geometry, Index="-1", Wrap=True)
constant_time_series = ConstantTimeSeriesAlpaca4d(LoadFactor=1)  # -> TimeSeries, Graph
demesh_3 = DeconstructMesh(Mesh=item_2)  # -> Vertices, Faces, Colours, Normals
Z = UnitZ(Factor=1)
X_2 = UnitX(Factor=1)
fnt = FourNodeTetrahedronAlpaca4d()
ssp = SSPBrickAlpaca4d(Mesh=mstb, Material=eim)
point_load = PointLoadAlpaca4d(Point=demesh.Vertices, Force=Z, Moment=Vector(0, 0, 0), TimeSeries=constant_time_series.TimeSeries)  # -> flatten(Load)
line = LineSDL(Start=demesh_3.Vertices, Direction=X_2, Length="5")
end = EndPoints(Curve=line)  # -> Start, End
geo = Geometry(end.End)
support = SupportAlpaca4d(Point=geo, Tx=True, Ty=True, Tz=True, Rx=True, Ry=True, RZ=True)
force_beam_column = ForceBeamColumnAlpaca4d(Line=line, Section=circlecs)
assemble_model = AssembleModelAlpaca4d(Element=flatten([ssp, force_beam_column]), Support=support, Load=flatten(point_load), Tollerance=0.01)  # -> AlpacaModel, Tcl
panel = Panel(assemble_model.Tcl)
python = GhPythonScript(x=assemble_model.AlpacaModel)  # -> out, a, b, c
# ---------- python: Python ----------
__author__ = "MarcoPellegrinoKonsu"
__version__ = "2022.07.30"

import rhinoscriptsyntax as rs

a =  x.UniquePointsSixNDF
b = x.UniquePointsThreeNDF

c = x.Nodes
# ---------- end python ----------
analysissettings = AnalysisSettingsAlpaca4d(System="BandGen", Algorithm="Linear")
sixndf = Geometry(python.a)
threendf = Geometry(python.b)
lng = ListLength(List=threendf)
lng_2 = ListLength(List=sixndf)
addition = Addition(A=lng, B=1)
explode = Explode(Object=analysissettings, Component="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")  # -> Constraint, Numberer, SystemEquation, Test, Algorithm, Integrator, Analysis, AnalysisStep, Damping
ra = RunAnalysisAlpaca4d(AlpacaModel=assemble_model.AlpacaModel, Settings=analysissettings)  # -> Log, AlpacaModel
series_2 = Series(Start="1", Step=1, Count=lng)
series_3 = Series(Start=addition, Step=1, Count=lng_2)
tag = TextTag(Location=threendf, Text=series_2)
tag_2 = TextTag(Location=sixndf, Text=series_3)
explode_2 = Explode(Object=explode.Algorithm, Component="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")
panel_2 = Panel(ra.Log)
rf = ReactionForcesAlpaca4d(AlpacaModel=ra.AlpacaModel, History=False, Step=0)  # -> SupportPosition, ReactionForce, ReactionMoment
nd = NodalDisplacementsAlpaca4d(AlpacaModel=ra.AlpacaModel, History=False, Step=0)  # -> Displacement, Rotation, port, Velocity, Acceleration
python_2 = GhPythonScript(x=ra.AlpacaModel)  # -> out, a
# ---------- python_2: Python ----------
__author__ = "MarcoPellegrinoKonsu"
__version__ = "2022.07.29"

import rhinoscriptsyntax as rs

a = x.UniquePoints
# ---------- end python_2 ----------
fnts = TetrahedronStressesAlpaca4d(AlpacaModel=ra.AlpacaModel, History=False, Step=0)  # -> Sigma11, Sigma22, Sigma33, Sigma12, Sigma23, Sigma13
number_slider = Slider(0, range=0..2)
multiplication = Multiplication(A=nd.Displacement, B="5e9")
vdisex = VectorDisplayEx(Point=rf.SupportPosition, Vector=rf.ReactionForce, Colour=RGB(0, 0, 0), Width=2)
move_2 = Move(Geometry=python_2.a, Motion=multiplication)  # -> Geometry, Transform
