# Grasshopper definition bunny.gh (Grasshopper 1.0.7)
# plug-ins: Alpaca4d

# Finite element meshing plugin for Grasshopper built on half-facet data-structures
# supporting non-manifold meshes and mixed dimensionalities.
# 
# 
# Copyright (C) 2020 by Seiichi Suzuki
# Alfred Wegener Institute Helmholtz Center for Marine and Polar Research (AWI)
# Bio-inspired Lightweight Design Research Group
# 
# Distributed under the terms of the GNU General Public License
panel = Panel("15")
number_slider = Slider(5, range=1..100)
mesh = Mesh([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])
Z = UnitZ(Factor=panel)
eim = ElasticIsotropicMaterialAlpaca4d(MaterialName="myMaterial", E="210000", G="75000", V="0.30", Rho="2100")
mesh_2 = Mesh([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])
move = Move(Geometry=mesh, Motion=Z)  # -> Geometry, Transform
eim_2 = ElasticIsotropicMaterialAlpaca4d()
mstb = MeshSeriesToBrickAlpaca4d(Meshes=move.Geometry, Closed=Toggle(False))
demesh = DeconstructMesh(Mesh=mesh_2)  # -> Vertices, Faces, Colours, Normals
split = SplitList(List=flatten(demesh.Vertices), Index="100")  # -> ListA, ListB
linear_time_series = LinearTimeSeriesAlpaca4d(LinearFactor=1)  # -> TimeSeries, Graph
fnt = FourNodeTetrahedronAlpaca4d(Mesh=mesh_2, Material=eim)
item = ListItem(List=mesh_2, Index=0, Wrap=True)
partition = PartitionList(Size=[3, 2])
Z_2 = UnitZ(Factor=1)
ssp = SSPBrickAlpaca4d(Mesh=mstb, Material=eim_2)
item_2 = ListItem(List=move.Geometry, Index=0, Wrap=True)  # -> Item, Item1
demesh_2 = DeconstructMesh(Mesh=item)  # -> Vertices, Faces, Colours, Normals
demesh_3 = DeconstructMesh(Mesh=item_2.Item1)  # -> Vertices, Faces, Colours, Normals
Z_3 = UnitZ(Factor=1)
point_load = PointLoadAlpaca4d(Point=flatten(split.ListA), Force=Z_2, Moment=Vector(0, 0, 0), TimeSeries=linear_time_series.TimeSeries)
demesh_4 = DeconstructMesh(Mesh=item_2.Item)  # -> Vertices, Faces, Colours, Normals
support = SupportAlpaca4d(Point=demesh_2.Vertices, Tx=True, Ty=True, Tz=True, Rx=True, Ry=True, RZ=True)
point_load_2 = PointLoadAlpaca4d(Point=demesh_3.Vertices, Force=Z_3, Moment=Vector(0, 0, 0))
support_2 = SupportAlpaca4d(Point=demesh_4.Vertices, Tx=True, Ty=True, Tz=True, Rx=True, Ry=True, RZ=True)
merge = Merge(Data1=ssp, Data2=fnt)  # -> flatten(Result)
rev = ReverseList(List=merge)
assemble_model = AssembleModelAlpaca4d(Element=flatten(rev), Support=flatten([support, support_2]), Load=flatten([point_load, point_load_2]), Tollerance=0.01)  # -> AlpacaModel, Tcl
analysissettings = AnalysisSettingsAlpaca4d()
ra = RunAnalysisAlpaca4d(AlpacaModel=assemble_model.AlpacaModel, Settings=analysissettings)  # -> Log, AlpacaModel
bs = BrickStressesAlpaca4d(AlpacaModel=ra.AlpacaModel, History=False, Step=0)  # -> Sigma11, Sigma22, Sigma33, Sigma12, Sigma23, Sigma13
nd = NodalDisplacementsAlpaca4d(AlpacaModel=ra.AlpacaModel, History=False, Step=0)  # -> Displacement, Rotation, port, Velocity, Acceleration; disabled
number_slider_2 = Slider(100, range=0..100)  # disabled
python = GhPythonScript(x=ra.AlpacaModel)  # -> out, a; disabled
# ---------- python: Python ----------
__author__ = "MarcoPellegrinoKonsu"
__version__ = "2022.07.18"

import rhinoscriptsyntax as rs

a = x.UniquePoints
# ---------- end python ----------
multiplication = Multiplication(A=nd.Displacement, B=number_slider_2)  # disabled
move_2 = Move(Geometry=python.a, Motion=multiplication)  # -> Geometry, Transform; disabled
