# Grasshopper definition hollowBeamBrick.gh (Grasshopper 1.0.7)
# plug-ins: Alpaca4d, Kangaroo2 Components, treesloth01

rectangle = Rectangle(Plane=PlaneXY(0, 0, 0), XSize=Domain(-1, 1), YSize=Domain(-2, 2), Radius=0)  # -> Rectangle, Length
panel = Panel("""0
0.25""")
offset = OffsetCurve(Curve=rectangle.Rectangle, Distance=panel, Corners=1)  # -> flatten(Curve)
crv = Curve(offset)
ml = MeshLoftAlpaca4d(Polylines=crv)
qrsettings = QuadRemeshSettings(TargetCount="40", AdaptiveSize=0, AdaptiveCount=False, HardEdges=False, SeamEdges=0, Symmetry=0, GuideCurves=0)
mesh = Mesh(ml)
boundary = BoundarySurfaces(Edges=crv)
qrmesh = QuadRemesh(Mesh=boundary, Settings=qrsettings)
series = Series(Start=0, Step="1", Count="30")
panel_2 = Panel("""0
-1""")
Z = UnitZ(Factor=series)
move = Move(Geometry=qrmesh, Motion=Z)  # -> Geometry, Transform
cull_i = CullIndex(List=move.Geometry, Indices=panel_2, Wrap=True)
item = ListItem(List=move.Geometry, Index=panel_2, Wrap=True)
item_2 = ListItem(Index=0, Wrap=True)
eim = ElasticIsotropicMaterialAlpaca4d()
mstb = MeshSeriesToBrickAlpaca4d(Meshes=move.Geometry, Closed=False)
first_last = FirstLast()  # -> FirstValue, LastValue
split = SplitList(List=move.Geometry, Index="1")  # -> ListA, ListB
demesh = DeconstructMesh(Mesh=item)  # -> Vertices, Faces, Colours, Normals
constant_time_series = ConstantTimeSeriesAlpaca4d(LoadFactor=1)  # -> TimeSeries, Graph
demesh_2 = DeconstructMesh(Mesh=cull_i)  # -> Vertices, Faces, Colours, Normals
Y = UnitY(Factor="10000000")
duppt = RemoveDuplicatePts(Points=demesh.Vertices, Tolerance=0.01)
ssp = SSPBrickAlpaca4d(Mesh=mstb, Material=eim)
support = SupportAlpaca4d(Point=duppt, Tx=True, Ty=True, Tz=True, Rx=True, Ry=True, RZ=True)  # -> flatten(Support)
point_load = PointLoadAlpaca4d(Point=demesh_2.Vertices, Force=Y, Moment=Vector(0, 0, 0), TimeSeries=constant_time_series.TimeSeries)  # -> flatten(Load)
assemble_model = AssembleModelAlpaca4d(Element=ssp, Support=support, Load=point_load, Tollerance=0.01)  # -> AlpacaModel, MassForce
modelview = ModelViewAlpaca4d(
    AlpacaModel=assemble_model.AlpacaModel,
    Extruded=False,
    Load=False,
    LoadFactor=1,
    Support=False,
    SupportFactor=1,
    Constraint=False)  # -> AlpacaModel, Info
panel_3 = Panel("0")
modelview_2 = ModelViewAlpaca4d(
    AlpacaModel=assemble_model.AlpacaModel,
    Extruded=False,
    Load=Toggle(True),
    LoadFactor="0.000001",
    Support=False,
    SupportFactor=1,
    Constraint=False)  # -> AlpacaModel, Info
analysissettings = AnalysisSettingsAlpaca4d(Algorithm="Linear")
number_slider = Slider(102, range=1..10000)
ra = RunAnalysisAlpaca4d(AlpacaModel=assemble_model.AlpacaModel, Settings=analysissettings)  # -> Log, AlpacaModel
nd = NodalDisplacementsAlpaca4d(AlpacaModel=ra.AlpacaModel, History=False, Step=0)  # -> Displacement, Rotation, port, Velocity, Acceleration
deformed_model_view = DeformedModelViewAlpaca4d(AlpacaModel=ra.AlpacaModel, Step=0, Scale=1)  # -> Line, Mesh
path = FilePath("C:\GitHub\OpenSeesGh\Tests\Gh\brick\myTCLFile.tcl")
slrz = SerializeAlpaca4d(AlpacaModel=ra.AlpacaModel, FilePath=path, Save=True)
