# Grasshopper definition 6x6-slab.gh (Grasshopper 1.0.7)
# plug-ins: Alpaca4d, MeshEdit Components, BH.UI.Grasshopper, Kangaroo2 Components, Karamba3D, NGon, Human

panel = Panel("16")
rectangle = Rectangle(Plane=PlaneXY(0, 0, 0), XSize="8", YSize="8", Radius=0)  # -> Rectangle, Length
panel_2 = Panel("25000")  # "kg/m3"
panel_3 = Panel("250000")
rectangle_2 = Rectangle(Plane=PlaneXY(0, 0, 0), XSize="8", YSize="8", Radius=0)  # -> Rectangle, Length
division = Division(A=panel_3, B="1000")
mplane = MeshPlane(Boundary=rectangle.Rectangle, WidthCount="30", HeightCount="30")  # -> Mesh, Area
# Alpaca4d
panel_4 = Panel(division)  # "kN/m3"
mplane_2 = MeshPlane(Boundary=rectangle_2.Rectangle, WidthCount="30", HeightCount="30")  # -> Mesh, Area
rectangle_3 = Rectangle(Plane=PlaneXY(0, 0, 0), XSize="8", YSize="8", Radius=0)  # -> Rectangle, Length
mc = MeshCorners(Mesh=mplane.Mesh, Angle=2.35619449)
panel_6 = Panel("250000")
panel_7 = Panel("31000000000")
panel_8 = Panel("""0.00
0.25
0.50""")
panel_10 = Panel("250000")
nv = NakedVertices(Mesh=mplane.Mesh)  # -> ClothedIndex, NakedIndex, ClothedPts, NakedPts
panel_11 = Panel("12916667000")
range = Range(Domain="0.50", Steps="5")
division_2 = Division(A=panel_6, B="1000")
panel_12 = Panel("2500")  # "kg/m3"
mplane_3 = MeshPlane(Boundary=rectangle_3.Rectangle, WidthCount="30", HeightCount="30")  # -> Mesh, Area
point = Point(mc)
# Alpaca4d
panel_13 = Panel(division_2)  # "kN/m3"
division_3 = Division(A=panel_10, B="1000")
point_2 = Point(nv.NakedPts)
division_4 = Division(A=panel_7, B="2.6")
panel_14 = Panel(division_4)
# Alpaca4d
panel_15 = Panel(division_3)  # "kN/m3"
toggle = BooleanToggle(True)
toggle_2 = BooleanToggle(True)
mc_2 = MeshCorners(Mesh=mplane_3.Mesh, Angle=2.35619449)
unit_z = UnitZ(Factor=range)
eim = ElasticIsotropicMaterialAlpaca4d(E=panel_7, G=panel_11, V="0.2", Rho=panel_12)
explode = Explode(Object=eim, Component="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")  # -> Id, MatName, E, G, Nu, Rho, MaterialDimension, MaterialType
support = SupportAlpaca4d(Point=point_2, Tx=toggle, Ty=toggle, Tz=toggle, Rx=toggle_2, Ry=toggle_2, RZ=toggle_2)
nv_2 = NakedVertices(Mesh=mplane_3.Mesh)  # -> ClothedIndex, NakedIndex, ClothedPts, NakedPts
explode_2 = MeshExplode(Mesh=mplane_3.Mesh, Interpolate=False)  # -> flatten(Faces)
explode_3 = MeshExplode(Mesh=mplane.Mesh, Interpolate=False)  # -> flatten(Faces)
move = Move(Geometry=mplane_2.Mesh, Motion=unit_z)  # -> Geometry, Transform
point_3 = Point(mc_2)
point_4 = Point(nv_2.NakedPts)
list_item = ListItem(List=move.Geometry, Index="1", Wrap=True)
constant_time_series = ConstantTimeSeriesAlpaca4d(LoadFactor=1)  # -> TimeSeries, Graph
pfs = PlateFiberSectionAlpaca4d(SectionName="wall1", Thickness="0.3", Material=eim)
toggle_3 = BooleanToggle(True)
toggle_4 = BooleanToggle(True)
mesh_edges = MeshEdges(Mesh=explode_2)  # -> NakedEdges, InteriorEdges, NonManifoldEdges
nv_3 = NakedVertices(Mesh=list_item)  # -> ClothedIndex, NakedIndex, ClothedPts, NakedPts
Z = UnitZ(Factor=1)
list_item_2 = ListItem(List=move.Geometry, Index=0, Wrap=True)  # -> Item1, Item
meshseriestobrick_alpaca4d = MeshSeriesToBrickAlpaca4d(Meshes=move.Geometry, Closed=False)
support_2 = SupportAlpaca4d(Point=point_4, Tx=toggle_3, Ty=toggle_3, Tz=toggle_3, Rx=toggle_4, Ry=toggle_4, RZ=toggle_4)
meshload = MeshLoadAlpaca4d(Force=Z, TimeSeries=constant_time_series.TimeSeries)
constant_time_series_alpaca4d = ConstantTimeSeriesAlpaca4d(LoadFactor=1)  # -> TimeSeries, Graph
point_5 = Point(nv_3.NakedPts)
asdq4 = ASDShellQ4Alpaca4d(Mesh=explode_3, Section=pfs, Colour=ColourSwatch(SwatchColor=RGB(255, 59, 222)))
elastic_isotropic_material_alpaca4d = ElasticIsotropicMaterialAlpaca4d()
deconstruct_mesh = DeconstructMesh(Mesh=list_item_2.Item1)  # -> Vertices, Faces, Colours, Normals
toggle_5 = BooleanToggle(True)
toggle_6 = BooleanToggle(True)
remove_duplicate_lines_karamba3d = RemoveDuplicateLinesKaramba3D(Line=flatten([mesh_edges.NakedEdges, mesh_edges.InteriorEdges]), LimitDistance=0.005)  # -> OutLine, Info, Indexes
constant_time_series_2 = ConstantTimeSeriesAlpaca4d(LoadFactor=1)  # -> TimeSeries, Graph
circlecs_alpaca4d = CircleCSAlpaca4d(Diameter=0.15, Thickness=0.01)
unit_z_2 = UnitZ(Factor=1)
analysissettings = AnalysisSettingsAlpaca4d()
point_load = PointLoadAlpaca4d(Moment=Vector(0, 0, 0))
gravity_load_alpaca4d = GravityLoadAlpaca4d(TimeSeriesType="Constant", GFactor=1)
support_3 = SupportAlpaca4d(Point=point_5, Tx=toggle_5, Ty=toggle_5, Tz=toggle_5, Rx=toggle_6, Ry=toggle_6, RZ=toggle_6)
Z_2 = UnitZ(Factor=1)
assemblemodel_alpaca4d = AssembleModelAlpaca4d(Element=asdq4, Support=support, Load=meshload, Tollerance=0.01)  # -> AlpacaModel, MassForce
point_load_alpaca4d = PointLoadAlpaca4d(
    Point=deconstruct_mesh.Vertices,
    Force=unit_z_2,
    Moment=Vector(0, 0, 0),
    TimeSeries=constant_time_series_alpaca4d.TimeSeries)
linearload = LinearLoadAlpaca4d()
gravity_load = GravityLoadAlpaca4d(TimeSeriesType="Constant", GFactor=1)
ssp_brick_alpaca4d = SSPBrickAlpaca4d(Mesh=meshseriestobrick_alpaca4d, Material=elastic_isotropic_material_alpaca4d)
analysissettings_2 = AnalysisSettingsAlpaca4d()
ra = RunAnalysisAlpaca4d(AlpacaModel=assemblemodel_alpaca4d.AlpacaModel, Settings=analysissettings)  # -> Log, AlpacaModel
linear_load_alpaca4d = LinearLoadAlpaca4d(Force=Z_2, TimeSeries=constant_time_series_2.TimeSeries)
force_beam_column_alpaca4d = ForceBeamColumnAlpaca4d(Line=remove_duplicate_lines_karamba3d.OutLine, Section=circlecs_alpaca4d)
number_slider = Slider(10, range=1..25)
panel_16 = Panel("""-genBandArpack
-symmBandLapack
-fullGenLapack""")
analysissettings_3 = AnalysisSettingsAlpaca4d()
point_load_2 = PointLoadAlpaca4d(Moment=Vector(0, 0, 0))
analysissettings_4 = AnalysisSettingsAlpaca4d()
ra_2 = RunAnalysisAlpaca4d(AlpacaModel=assemblemodel_alpaca4d.AlpacaModel, Settings=analysissettings_2)  # -> Log, AlpacaModel
natural_vibration_analysis_alpaca4d = NaturalVibrationAnalysisAlpaca4d(AlpacaModel=assemblemodel_alpaca4d.AlpacaModel, VibrationModes=1, Solver="-fullGenLapack")  # -> Log, AlpacaModel, Eigenvalues, Period, Frequencies; disabled
item = ListItem(List=panel_16, Index=0, Wrap=True)
assemblemodel_alpaca4d_2 = AssembleModelAlpaca4d(Element=force_beam_column_alpaca4d, Support=support_2, Load=linear_load_alpaca4d, Tollerance=0.01)  # -> AlpacaModel, MassForce
linearload_2 = LinearLoadAlpaca4d()
gravity_load_2 = GravityLoadAlpaca4d(TimeSeriesType="Constant", GFactor=1)
analysissettings_5 = AnalysisSettingsAlpaca4d()
assemblemodel_alpaca4d_3 = AssembleModelAlpaca4d(Element=ssp_brick_alpaca4d, Support=support_3, Load=point_load_alpaca4d, Tollerance=0.01)  # -> AlpacaModel, MassForce
nv_4 = NaturalVibrationAnalysisAlpaca4d(AlpacaModel=assemblemodel_alpaca4d.AlpacaModel, VibrationModes="30", Solver=item)  # -> Log, AlpacaModel, Eigenvalues, Period, Frequencies
ra_3 = RunAnalysisAlpaca4d(AlpacaModel=assemblemodel_alpaca4d_2.AlpacaModel, Settings=analysissettings_3)  # -> Log, AlpacaModel
number_slider_2 = Slider(10, range=1..25)
range_2 = Range(Domain=Domain(0, 1), Steps=10)
series = Series(Start=0, Step=1, Count="30")
panel_17 = Panel("""-genBandArpack
-symmBandLapack
-fullGenLapack""")
ra_4 = RunAnalysisAlpaca4d(AlpacaModel=assemblemodel_alpaca4d_3.AlpacaModel, Settings=analysissettings_4)  # -> Log, AlpacaModel
number_slider_3 = Slider(25, range=0..29)
nd = NodalDisplacementsAlpaca4d(AlpacaModel=ra_2.AlpacaModel, History=False, Step=0)  # -> Displacement, Rotation, port, Velocity, Acceleration
sf = ShellForcesAlpaca4d(AlpacaModel=ra.AlpacaModel, History=False, Step=0)  # -> Fx, Fy, Fxy, Mx, My, Mxy, Vxz, Vyz
panel_18 = Panel("""0
1
2""")
ra_5 = RunAnalysisAlpaca4d(AlpacaModel=assemblemodel_alpaca4d_2.AlpacaModel, Settings=analysissettings_5)  # -> Log, AlpacaModel
natural_vibration_analysis_alpaca4d_2 = NaturalVibrationAnalysisAlpaca4d(AlpacaModel=assemblemodel_alpaca4d_2.AlpacaModel, VibrationModes=1, Solver="-fullGenLapack")  # -> Log, AlpacaModel, Eigenvalues, Period, Frequencies; disabled
item_2 = ListItem(List=panel_17, Index=0, Wrap=True)
number_slider_4 = Slider(1000, range=1..1000)
mar = ModalAnalysisReportAlpaca4d(AlpacaModel=nv_4.AlpacaModel)  # -> EigenValueAnalysis, TotalMassOfStructure, TotalFreeMass, CenterOfMass, ModalParticipationFactors, ModalParticipationMasses, ModalParticipationMasses_Cumulative, ModalParticipationMassesRatio, ModalParticipationMassesRatio_Cumulative
clr = ColorsAlpaca4d(GradientIndex=Slider(9, range=0..12))
nv_5 = NaturalVibrationAnalysisAlpaca4d(AlpacaModel=assemblemodel_alpaca4d_2.AlpacaModel, VibrationModes="30", Solver=item_2)  # -> Log, AlpacaModel, Eigenvalues, Period, Frequencies
model_view_alpaca4d = ModelViewAlpaca4d(
    AlpacaModel=assemblemodel_alpaca4d_3.AlpacaModel,
    Extruded=False,
    Load=False,
    LoadFactor=1,
    Support=Toggle(True),
    SupportFactor=Slider(0.193, range=0.001..1),
    Constraint=False)  # -> AlpacaModel, Info
# Modal Analysis
panel_19 = Panel("100000000")
range_3 = Range(Domain=Domain(0, 1), Steps=10)
series_2 = Series(Start=0, Step=1, Count="30")
deformed_model_view = DeformedModelViewAlpaca4d(AlpacaModel=ra_2.AlpacaModel, Step=0, Scale=panel_19)  # -> Line, Mesh, Brick
nd_2 = NodalDisplacementsAlpaca4d(AlpacaModel=ra_5.AlpacaModel, History=False, Step=0)  # -> Displacement, Rotation, port, Velocity, Acceleration
number_slider_5 = Slider(25, range=0..29)
sf_2 = ShellForcesAlpaca4d(AlpacaModel=ra_3.AlpacaModel, History=False, Step=0)  # -> Fx, Fy, Fxy, Mx, My, Mxy, Vxz, Vyz
brick_stresses_alpaca4d = BrickStressesAlpaca4d(AlpacaModel=ra_4.AlpacaModel, History=False, Step=0)  # -> Sigma11, Sigma22, Sigma33, Sigma12, Sigma23, Sigma13
deformed_model_view_2 = DeformedModelViewAlpaca4d(AlpacaModel=nv_4.AlpacaModel, Step=series, Scale=Slider(201.47, range=0..10000), Colors=clr)  # -> Line, simplify(Mesh), Brick
nd_3 = NodalDisplacementsAlpaca4d(AlpacaModel=nv_4.AlpacaModel, History=False, Step=Slider(1, range=1..12))  # -> Displacement, Rotation, port, Velocity, Acceleration
# Modal Analysis
nd_4 = NodalDisplacementsAlpaca4d(History=False, Step=0)  # -> Displacement, Rotation, port, Velocity, Acceleration
sf_3 = ShellForcesAlpaca4d(AlpacaModel=ra_4.AlpacaModel, History=False, Step=0)  # -> Fx, Fy, Fxy, Mx, My, Mxy, Vxz, Vyz
geometry = Geometry(meshseriestobrick_alpaca4d)
number_slider_6 = Slider(1000, range=1..1000)
mar_2 = ModalAnalysisReportAlpaca4d(AlpacaModel=nv_5.AlpacaModel)  # -> EigenValueAnalysis, TotalMassOfStructure, TotalFreeMass, CenterOfMass, ModalParticipationFactors, ModalParticipationMasses, ModalParticipationMasses_Cumulative, ModalParticipationMassesRatio, ModalParticipationMassesRatio_Cumulative
number_slider_7 = Slider(10, range=1..25)  # disabled
panel_21 = Panel("""-genBandArpack
-symmBandLapack
-fullGenLapack""")  # disabled
clr_2 = ColorsAlpaca4d(GradientIndex=Slider(9, range=0..12))
panel_22 = Panel(mar.EigenValueAnalysis)
# Modal Analysis
deformed_model_view_3 = DeformedModelViewAlpaca4d(AlpacaModel=ra_5.AlpacaModel, Step=0, Scale="300000")  # -> Line, Mesh, Brick
panel_23 = Panel("30")  # disabled
item_3 = ListItem(List=panel_21, Index=0, Wrap=True)  # disabled
absolute = Absolute(Value=brick_stresses_alpaca4d.Sigma11)
branch = TreeBranch(Tree=deformed_model_view_2.Mesh, Path=Slider(0, range=0..100), MaintainPaths=True)
branch_2 = TreeBranch(Tree=deformed_model_view_2.Mesh, Path=Slider(2, range=0..100), MaintainPaths=True)
deformed_model_view_4 = DeformedModelViewAlpaca4d(AlpacaModel=nv_5.AlpacaModel, Step=series_2, Scale=Slider(201.47, range=0..10000), Colors=clr_2)  # -> simplify(Line), simplify(Mesh), simplify(Brick)
nd_5 = NodalDisplacementsAlpaca4d(AlpacaModel=nv_5.AlpacaModel, History=False, Step=Slider(1, range=1..12))  # -> Displacement, Rotation, port, Velocity, Acceleration
item_4 = ListItem(Index=0, Wrap=True)
nv_6 = NaturalVibrationAnalysisAlpaca4d(AlpacaModel=assemblemodel_alpaca4d_3.AlpacaModel, VibrationModes=panel_23, Solver=item_3)  # -> Log, AlpacaModel, Eigenvalues, Period, Frequencies; disabled
sort_list = SortList(Keys=absolute)  # -> reverse(Keys), ValuesA
range_4 = Range(Domain=Domain(0, 1), Steps=10)  # disabled
series_3 = Series(Start=0, Step=1, Count=panel_23)  # disabled
panel_24 = Panel(mar_2.EigenValueAnalysis)
number_slider_8 = Slider(9, range=0..12)  # disabled
number_slider_9 = Slider(1, range=1..12)  # disabled
number_slider_10 = Slider(25, range=0..29)  # disabled
panel_25 = Panel("""0
1
2""")  # disabled
list_item_3 = ListItem(List=sort_list.Keys, Index=0, Wrap=True)
bounds = Bounds(Numbers=brick_stresses_alpaca4d.Sigma11)
mar_3 = ModalAnalysisReportAlpaca4d(AlpacaModel=nv_6.AlpacaModel)  # -> EigenValueAnalysis, TotalMassOfStructure, TotalFreeMass, CenterOfMass, ModalParticipationFactors, ModalParticipationMasses, ModalParticipationMasses_Cumulative, ModalParticipationMassesRatio, ModalParticipationMassesRatio_Cumulative; disabled
number_slider_11 = Slider(314.161, range=0..10000)  # disabled
clr_3 = ColorsAlpaca4d(GradientIndex=number_slider_8)  # disabled
branch_3 = TreeBranch(Tree=deformed_model_view_4.Line, Path=Slider(0, range=0..100), MaintainPaths=True)
bounding_box = BoundingBox(Content=geometry, Plane=PlaneXY(0, 0, 0), UnionBox=True)  # -> Box, Box_2
branch_4 = TreeBranch(Tree=deformed_model_view_4.Mesh, Path=Slider(2, range=0..100), MaintainPaths=True)
branch_5 = TreeBranch(Tree=deformed_model_view_4.Mesh, Path=Slider(9, range=0..100), MaintainPaths=True)
negative = Negative(Value=list_item_3)
area = Area(Geometry=geometry)  # -> Area, Centroid
range_5 = Range(Domain=bounds, Steps="5")
panel_26 = Panel("17")  # disabled
number = Number(brick_stresses_alpaca4d.Sigma11)
deformed_model_view_5 = DeformedModelViewAlpaca4d(AlpacaModel=nv_6.AlpacaModel, Step=panel_26, Scale=number_slider_11, Colors=clr_3)  # -> simplify(Line), simplify(Mesh), simplify(Brick); disabled
nd_6 = NodalDisplacementsAlpaca4d(AlpacaModel=nv_6.AlpacaModel, History=False, Step=number_slider_9)  # -> Displacement, Rotation, port, Velocity, Acceleration; disabled
gradient = Gradient(
    LowerLimit=negative,
    UpperLimit=list_item_3,
    Parameter=number,
    stops=[0: RGBA(237, 26, 58, 0), 0: RGBA(209, 0, 118, 0), 0: RGBA(242, 57, 0, 0), 0: RGB(103, 0, 120), 0.141: RGB(39, 72, 161), 0.283: RGB(1, 192, 229), 0.43: RGB(18, 178, 90), 0.56: RGB(79, 186, 8), 0.698: RGB(220, 237, 32), 0.838: RGB(247, 159, 20), 1: RGB(243, 57, 0)])
panel_27 = Panel("-40")
isosurface = IsoSurface(
    Box=bounding_box.Box,
    Values=brick_stresses_alpaca4d.Sigma11,
    XResolution="30",
    YResolution="30",
    ZResolution="5",
    IsoValue=range_5,
    MergeVertices=False)
deconstruct_domain = DeconstructDomain(Domain=bounds)  # -> Start, End
panel_28 = Panel(mar_3.EigenValueAnalysis)  # disabled
dot_display = DotDisplay(Point=area.Centroid, Colour=gradient, Size="0.05")
gradient_2 = Gradient(
    LowerLimit=deconstruct_domain.Start,
    UpperLimit=deconstruct_domain.End,
    Parameter=range_5,
    stops=[0: RGBA(237, 26, 58, 0), 0: RGBA(209, 0, 118, 0), 0: RGBA(242, 57, 0, 0), 0: RGB(103, 0, 120), 0.141: RGB(39, 72, 161), 0.283: RGB(1, 192, 229), 0.43: RGB(18, 178, 90), 0.56: RGB(79, 186, 8), 0.698: RGB(220, 237, 32), 0.838: RGB(247, 159, 20), 1: RGB(243, 57, 0)])
combine_clean = CombineClean(Meshes=graft(isosurface))
mesh_edges_2 = MeshEdges(Mesh=combine_clean)  # -> NakedEdges, InteriorEdges, NonManifoldEdges
custom_preview = CustomPreview(Geometry=isosurface, Material=gradient_2)
curve = Curve(mesh_edges_2.NakedEdges)
custom_preview_lineweights = CustomPreviewLineweights(Geometry=curve, Shader=ColourSwatch(SwatchColor=RGB(8, 8, 8)), Thickness="3", Absolute=False)
