# Grasshopper definition FootbridgeStudy.gh (Grasshopper 1.0.7)
# plug-ins: Galapagos, Alpaca4d

# ---- group: 1 - The design: four inputs studied, two kept
# How to run the study: Footbridge design study - the Alpaca4d Explorer example.
# 
# Two steel Warren trusses, 2.5 m apart, studied over 4 spans x 3 depths x 3 panel counts x 3 chord sections: 108 designs. Each is analysed under its own weight and a deck load, checked to EN 1993-1-1 and solved for its first natural frequency.
# 
# 1. Save this definition. The study is recorded next to it, in AlpacaExplorer.
# 2. Show the bridge in a perspective view in Rhino: each design's picture is taken from the active viewport.
# 3. Set Write, on Explorer Record, to true.
# 4. Press Fly under Explorer Inputs. Right-click it > Test fly runs three designs first, to check the pictures.
# 5. Right-click Explorer Record > Open the Alpaca4d Explorer, and drop the study folder on the page.
span_m = ValueList({"20", "25", "30", "35"}, selected="30")
depth_m = ValueList({"1.5", "2.25", "3"}, selected="2.25")
panels = Slider(8, range=6..10)
chord = ValueList({"HEA160", "HEA200", "HEA240"}, selected="HEA200")
width_m = Slider(2.5, range=2..4)
deck_load_kn_m = Slider(-6.25, range=-10..0)

# ---- group: 7 - Explorer Inputs: press Fly to run the study
explorer_inputs = ExplorerInputsAlpaca4d(Fly=False, In_1=span_m, In_2=depth_m, In_3=panels, In_4=chord)  # -> Inputs, Name, Val_1, Val_2, Val_3, Val_4, Val_5

# ---- group: 2 - Two Warren trusses, joined at every node
panel_length = Expression(s=span_m, n=panels, Expression="s/n")
half_a_panel = Expression(d=panel_length, Expression="d/2")
bottom_x = Range(Domain=span_m, Steps=panels)
top_x = Series(Start=half_a_panel, Step=panel_length, Count=panels)
bottom_nodes = ConstructPoint(XCoordinate=bottom_x, YCoordinate=0, ZCoordinate=0)
top_nodes = ConstructPoint(XCoordinate=top_x, YCoordinate=0, ZCoordinate=depth_m)
zig_zag = Weave(Pattern=[0, 1], Stream0=bottom_nodes, Stream1=top_nodes, NullGaps=False)
across = UnitY(Factor=width_m)
bottom_chord = PolyLine(Vertices=bottom_nodes, Closed=False)
top_chord = PolyLine(Vertices=top_nodes, Closed=False)
diagonals = PolyLine(Vertices=zig_zag, Closed=False)
bottom_nodes_b = Move(Geometry=bottom_nodes, Motion=across)  # -> Geometry, Transform
top_nodes_b = Move(Geometry=top_nodes, Motion=across)  # -> Geometry, Transform
bottom_chord_b = Move(Geometry=bottom_chord, Motion=across)  # -> Geometry, Transform
top_chord_b = Move(Geometry=top_chord, Motion=across)  # -> Geometry, Transform
diagonals_b = Move(Geometry=diagonals, Motion=across)  # -> Geometry, Transform
floor_beams = Line(StartPoint=bottom_nodes, EndPoint=bottom_nodes_b.Geometry)
top_ties = Line(StartPoint=top_nodes, EndPoint=top_nodes_b.Geometry)
bottom_chords = Explode(Curve=[bottom_chord, bottom_chord_b.Geometry], Recursive=True)  # -> Segments, Vertices
top_chords = Explode(Curve=[top_chord, top_chord_b.Geometry], Recursive=True)  # -> Segments, Vertices
diagonals_2 = Explode(Curve=[diagonals, diagonals_b.Geometry], Recursive=True)  # -> Segments, Vertices
bearings = EndPoints(Curve=[bottom_chord, bottom_chord_b.Geometry])  # -> Start, End

# ---- group: 3 - Members
grade = Panel("S355")
material_library_elastic = MaterialLibraryElasticAlpaca4d(
    MaterialName=grade,
    MaterialPresetElastic_Grade="S235",
    MaterialPresetElastic_Model="Uniaxial",
    MaterialPresetElastic_Type="Steel",
    menu=[dropdown(0), dropdown(1), dropdown(0)])
diagonals_3 = Panel("HEA120")
cross_beams = Panel("IPE180")
chord_2 = SteelSectionLibraryAlpaca4d(SectionName=chord, Material=material_library_elastic, menu=[dropdown(0), dropdown(1)])
diagonal = SteelSectionLibraryAlpaca4d(SectionName=diagonals_3, Material=material_library_elastic, menu=[dropdown(0), dropdown(1)])
cross_beam = SteelSectionLibraryAlpaca4d(SectionName=cross_beams, Material=material_library_elastic, menu=[dropdown(0), dropdown(1)])
bottom_chords_2 = ForceBeamColumnAlpaca4d(Line=flatten(bottom_chords.Segments), Section=chord_2, Colour=RGB(1, 30, 254), mode="ForceBeamColumn (Alpaca4d)")
top_chords_2 = ForceBeamColumnAlpaca4d(Line=flatten(top_chords.Segments), Section=chord_2, Colour=RGB(1, 30, 254), mode="ForceBeamColumn (Alpaca4d)")
diagonals_4 = ForceBeamColumnAlpaca4d(Line=flatten(diagonals_2.Segments), Section=diagonal, Colour=RGB(1, 30, 254), mode="ForceBeamColumn (Alpaca4d)")
cross_beams_2 = ForceBeamColumnAlpaca4d(Line=flatten([floor_beams, top_ties]), Section=cross_beam, Colour=RGB(1, 30, 254), mode="ForceBeamColumn (Alpaca4d)")

# ---- group: 4 - Bearings and loads
restrained = BooleanToggle(True)
free = BooleanToggle(False)
gravity_load = GravityLoadAlpaca4d(Factor=1)
downwards = UnitZ(Factor=deck_load_kn_m)
pinned = SupportAlpaca4d(Position=bearings.Start, Tx=restrained, Ty=restrained, Tz=restrained, Rx=free, Ry=free, Rz=free)
sliding = SupportAlpaca4d(Position=bearings.End, Tx=free, Ty=restrained, Tz=restrained, Rx=free, Ry=free, Rz=free)
deck_load = LinearLoadAlpaca4d(BeamElement=bottom_chords_2, Force=downwards)
load_pattern = LoadPatternAlpaca4d(Loads=[gravity_load, deck_load], Factor=1, mode="PlainPattern (Alpaca4d)")

# ---- group: 5 - Analysis
assemble_model = AssembleModelAlpaca4d(
    Elements=[bottom_chords_2, top_chords_2, diagonals_4, cross_beams_2],
    Supports=[pinned, sliding],
    LoadPatterns=load_pattern,
    Tolerance=0.01)  # -> AlpacaModel, Mass
natural_vibration = NaturalVibrationAnalysisAlpaca4d(AlpacaModel=assemble_model.AlpacaModel, VibrationModes=1, Solver="-genBandArpack")  # -> AlpacaModel, Eigenvalues, Period, Frequencies, Log, EigenValueAnalysis, TotalMassOfStructure, TotalFreeMass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
analysis_settings = AnalysisSettingsAlpaca4d(Constraint="Transformation", Numberer="RCM", System="BandSPD", Algorithm="Newton", AnalysisType="Static")
run_analysis = RunAnalysisAlpaca4d(AlpacaModel=assemble_model.AlpacaModel, Settings=analysis_settings, settings=True)  # -> AlpacaModel, Log
modelview = ModelViewAlpaca4d(AlpacaModel=run_analysis.AlpacaModel)  # -> AlpacaModel, Info

# ---- group: 6 - Results
utilisation = UtilisationAlpaca4d(AlpacaModel=run_analysis.AlpacaModel, Step=0, Fabrication="Rolled", ΓM0=1, ΓM1=1, Report=False)  # -> Axial, ShearY, ShearZ, Torsion, BendingY, BendingZ, Combined, BucklingY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
mass_in_t = Expression(m=assemble_model.Mass, Expression="m/1000")
nodal_displacements = NodalDisplacementsAlpaca4d(AlpacaModel=run_analysis.AlpacaModel, History=False, Step=0)  # -> Position, Displacement, Rotation, port, Velocity, AngularVelocity, Acceleration, AngularAcceleration
vlen = VectorLength(Vector=nodal_displacements.Displacement)
highest = Bounds(Numbers=utilisation.Max)
largest = Bounds(Numbers=vlen)
highest_value = DeconstructDomain(Domain=highest)  # -> Start, End
largest_value = DeconstructDomain(Domain=largest)  # -> Start, End
deflection_in_mm = Expression(u=largest_value.End, Expression="u*1000")

# ---- group: 8 - What each design is saved with
explorer_outputs = ExplorerOutputsAlpaca4d(
    Mass_t=flatten(mass_in_t),
    Deflection_mm=flatten(deflection_in_mm),
    Utilisation=flatten(highest_value.End),
    Frequency_Hz=flatten(natural_vibration.Frequencies))
write = BooleanToggle(False)
explorer_record = ExplorerRecordAlpaca4d(Inputs=explorer_inputs.Inputs, Outputs=explorer_outputs, Model=run_analysis.AlpacaModel, Write=write)  # -> Folder, Designs
