# Grasshopper definition All_Element_Test2.gh (Grasshopper 1.0.7)
# plug-ins: Kangaroo2 Components, TetgenGH

numero_piani = Slider(5, range=0..100)
interasse_x = Slider(10, range=0..10)
interasse_y = Slider(4, range=0..10)
number_slider = Slider(0, range=0..10)
campate_y = Slider(4, range=0..10)
campate_x = Slider(3, range=0..10)
h_int = Slider(4, range=0..10)

series = Series(Start=0, Step=h_int, Count=numero_piani)
pt = ConstructPoint(XCoordinate=number_slider, YCoordinate=number_slider, ZCoordinate=number_slider)
X = UnitX(Factor=interasse_x)
move = Move(Geometry=pt, Motion=X)  # -> Geometry, Transform
series_2 = Series(Start=0, Step=interasse_y, Count=campate_y)
subtraction = Subtraction(A=campate_y, B=1)
ln = Line(StartPoint=pt, EndPoint=move.Geometry)
Y = UnitY(Factor=series_2)
move_2 = Move(Geometry=ln, Motion=Y)  # -> Geometry, Transform
addition = Addition(A=campate_x, B="1")
divide = DivideCurve(Curve=move_2.Geometry, Count=campate_x, Kinks=False)  # -> Points, Tangents, Parameters
shatter = Shatter(Curve=graft(move_2.Geometry), Parameters=divide.Parameters)
flip = FlipMatrix(Data=divide.Points)
pline = PolyLine(Vertices=flip, Closed=False)
Z = UnitZ(Factor=series)  # -> graft(UnitVector)
data = Data(flatten([shatter, pline]))
move_3 = Move(Geometry=data, Motion=Z)  # -> Geometry, Transform
explode = Explode(Curve=move_3.Geometry, Recursive=True)  # -> Segments, Vertices
end = EndPoints(Curve=ln)  # -> Start, End
trim = TrimTree(Tree=explode.Vertices, Depth=1)
duppt = RemoveDuplicatePts(Points=trim, Tolerance=0.01)
flip_2 = FlipMatrix(Data=duppt)
trim_2 = TrimTree(Tree=explode.Segments, Depth=1)
sort_pt = SortPoints(Points=duppt)  # -> Points, Indices
pline_2 = PolyLine(Vertices=flip_2, Closed=False)
split = SplitTree(Data=simplify(trim_2), Masks=flatten("{0}"))  # -> Positive, Negative
explode_2 = Explode(Curve=pline_2, Recursive=True)  # -> Segments, Vertices
srfgrid = SurfaceFromPoints(Points=sort_pt.Points, UCount=addition, Interpolate=False)
flip_3 = FlipMatrix(Data=explode_2.Segments)
mesh_uv = MeshSurface(Surface=srfgrid, UCount=subtraction, VCount=campate_x, Overhang=True, Equalize=False)  # -> flatten(Mesh)
explode_3 = Explode(Curve=flatten(split.Negative), Recursive=True)  # -> Segments, flatten(Vertices)
explode_4 = Explode(Curve=flatten(split.Positive), Recursive=True)  # -> Segments, flatten(Vertices)
duppt_2 = RemoveDuplicatePts(Points=explode_3.Vertices, Tolerance=0.01)
duppt_3 = RemoveDuplicatePts(Points=explode_4.Vertices, Tolerance=0.01)
item = ListItem(List=mesh_uv, Index="0", Wrap=True)
cull_i = CullIndex(List=mesh_uv, Indices="0", Wrap=True)
beam = Data(simplify(split.Negative))
nv = NakedVertices(Mesh=item)  # -> ClothedIndex, NakedIndex, ClothedPts, NakedPts
turn = MeshTurn(Mesh=cull_i)
dupln = RemoveDuplicateLines(Lines=beam, Tolerance=0.01)
data_2 = Data(nv.NakedPts)
fcircle = CircleFit(Points=data_2)  # -> Circle, Radius, Deviation
alongcrv = SortAlongCurve(Points=data_2, Curve=fcircle.Circle)  # -> Points, Indices
pline_3 = PolyLine(Vertices=alongcrv.Points, Closed=Toggle(True))  # -> reparameterize(Polyline)
explode_5 = Explode(Curve=pline_3, Recursive=True)  # -> Segments, Vertices
len = Length(Curve=explode_5.Segments)
area = Area(Geometry=pline_3)  # -> Area, Centroid
ma = MassAddition(Input=len)  # -> Result, PartialResults
dom = ConstructDomain(DomainStart="1", DomainEnd=Slider(5, range=0..100))
range = Range(Domain=dom, Steps="1")
eval = EvaluateLength(Curve=pline_3, Length=ma.PartialResults, Normalized=Toggle(False))  # -> Point, Tangent, Parameter
ins = InsertItems(List=eval.Parameter, Item="0", Indices="0", Wrap=True)
scale = Scale(Geometry=pline_3, Center=area.Centroid, Factor=range)  # -> Geometry, Transform
shatter_2 = Shatter(Curve=reparameterize(scale.Geometry), Parameters=ins)
flip_4 = FlipMatrix(Data=shatter_2)
loft = Loft(Curves=flip_4, Options={Adjust=False, Closed=False, LoftEnds=0, LoftSimp=0, LoftType=0, Rebuild=10, Refit=0.01})
number_slider_2 = Slider(4, range=0..10)
mesh_uv_2 = MeshSurface(Surface=loft, UCount=Slider(5, range=0..100), VCount="1", Overhang=True, Equalize=False)  # -> flatten(Mesh)
series_3 = Series(Start=0, Step=number_slider_2, Count=Slider(4, range=0..10))
mjoin = MeshJoin(Meshes=[item, mesh_uv_2])
Z_2 = UnitZ(Factor=series_3)
neg = Negative(Value=Z_2)
clean = CombineClean(Meshes=mjoin)
panel = Panel("2")
move_4 = Move(Geometry=clean, Motion=neg)  # -> Geometry, Transform
Z_3 = UnitZ(Factor=number_slider_2)
item_2 = ListItem(List=move_4.Geometry, Index=0, Wrap=True)  # -> Item1, Item
neg_2 = Negative(Value=Z_3)
move_5 = Move(Geometry=item_2.Item1, Motion=neg_2)  # -> Geometry, Transform
nv_2 = NakedVertices(Mesh=move_5.Geometry)  # -> ClothedIndex, NakedIndex, ClothedPts, NakedPts
nv_3 = NakedVertices(Mesh=item_2.Item1)  # -> ClothedIndex, NakedIndex, ClothedPts, NakedPts
mstb = MeshSeriesToBrickAlpaca4d(MeshSeries=move_4.Geometry)  # -> simplify(flatten(Brick)); inputs MeshSeries: list of Mesh
# ---------- mstb: Python ----------
"""Generate a Brick element from a list of mesh .
    the faces of the mesh '0' will be connected with the faces of the meshes '1' generating a brick element ( cube ).
    Attention : Each mesh in the list must have the same number of faces.
    Inputs:
        MeshSeries: quadMesh list with the same number of subdivisions .
    Output:
        Brick: Brick element --> Mesh with 6 faces and 8 nodes.
       """
import Rhino.Geometry as rg
import Grasshopper as gh

def MeshToShell(Mesh):
    
    Mesh.Unweld(0, True)
    mesh = Mesh.ExplodeAtUnweldedEdges()
    #print( len(mesh) )
    newMesh = []
    elementType = []
    for explodedMesh in mesh:
        newMesh.append(explodedMesh)
    return newMesh 

def brick( MeshList ):
    meshExpl = []
    Vertix = []
    elementType = []
    solid = []
    a = rg.Mesh.DuplicateMesh( MeshList[0] ) #.Unweld(0, True)
    a.Unweld(0, True)
    b = a.ExplodeAtUnweldedEdges()
    if len( b ) > 0 :
        for Mesh in MeshList:
            shellWrapper = MeshToShell(Mesh)
            meshExpl.append( shellWrapper )
        for index1 in range(0, len(MeshList)-1):
            for index2 in range(0, len(meshExpl[0])):
                if meshExpl[ index1 ][ index2 ].Vertices.Count == 4:
                    
                    elementType.append("stdBrick")
                    vertix1 = meshExpl[ index1 ][ index2 ].Vertices[0]
                    vertix2 = meshExpl[ index1 ][ index2 ].Vertices[1]
                    vertix3 = meshExpl[ index1 ][ index2 ].Vertices[2]
                    vertix4 = meshExpl[ index1 ][ index2 ].Vertices[3]
                    vertix5 = meshExpl[index1 + 1 ][ index2].Vertices[0]
                    vertix6 = meshExpl[index1 + 1 ][ index2].Vertices[1]
                    vertix7 = meshExpl[index1 + 1 ][ index2].Vertices[2]
                    vertix8 = meshExpl[index1 + 1 ][ index2].Vertices[3]
                    
                    vertix = [ vertix1, vertix2, vertix3, vertix4,
                    vertix5, vertix6, vertix7, vertix8 ]
                    
                    ele = rg.Mesh()
                    
                    ele.Vertices.Add( vertix1 ) # 0 
                    ele.Vertices.Add( vertix2 ) # 1
                    ele.Vertices.Add( vertix3 ) # 2
                    ele.Vertices.Add( vertix4 ) # 3
                    ele.Vertices.Add( vertix5 ) # 4
                    ele.Vertices.Add( vertix6 ) # 5
                    ele.Vertices.Add( vertix7 ) # 6
                    ele.Vertices.Add( vertix8 ) # 7
                    
                    ele.Faces.AddFace(0, 1, 2, 3) # 0
                    ele.Faces.AddFace(4, 5, 6, 7) # 1
                    ele.Faces.AddFace(0, 1, 5, 4) # 2
                    ele.Faces.AddFace(3, 2, 6, 7) # 3
                    ele.Faces.AddFace(1, 5, 6, 2) # 4
                    ele.Faces.AddFace(0, 4, 7, 3) # 5
                solid.append(ele)
                #ele.IsClosed()
                    
    else:
        for index1 in range(0, len(MeshList)-1):
            elementType.append("stdBrick")
            vertix1 = MeshList[ index1 ].Vertices[0]
            vertix2 = MeshList[ index1 ].Vertices[1]
            vertix3 = MeshList[ index1 ].Vertices[2]
            vertix4 = MeshList[ index1 ].Vertices[3]
            vertix5 = MeshList[index1 + 1 ].Vertices[0]
            vertix6 = MeshList[index1 + 1 ].Vertices[1]
            vertix7 = MeshList[index1 + 1 ].Vertices[2]
            vertix8 = MeshList[index1 + 1 ].Vertices[3]
            
            vertix = [ vertix1, vertix2, vertix3, vertix4,
            vertix5, vertix6, vertix7, vertix8 ]
            
            ele = rg.Mesh()
            
            ele.Vertices.Add( vertix1 ) # 0 
            ele.Vertices.Add( vertix2 ) # 1
            ele.Vertices.Add( vertix3 ) # 2
            ele.Vertices.Add( vertix4 ) # 3
            ele.Vertices.Add( vertix5 ) # 4
            ele.Vertices.Add( vertix6 ) # 5
            ele.Vertices.Add( vertix7 ) # 6
            ele.Vertices.Add( vertix8 ) # 7
            
            ele.Faces.AddFace(0, 1, 2, 3) # 0
            ele.Faces.AddFace(4, 5, 6, 7) # 1
            ele.Faces.AddFace(0, 1, 5, 4) # 2
            ele.Faces.AddFace(3, 2, 6, 7) # 3
            ele.Faces.AddFace(1, 5, 6, 2) # 4
            ele.Faces.AddFace(0, 4, 7, 3) # 5
            
            solid.append(ele)
            '''
            else :
                elementType.append(["FourNodeTetrahedron"]*3)
                
                if meshExpl[ index1 ][ index2 ].Vertices[0] == meshExpl[index1 + 1 ][ index2].Vertices[0] :
                    vertix1 = meshExpl[ index1 ][ index2 ].Vertices[0]
                    vertix2 = meshExpl[ index1 ][ index2 ].Vertices[1]
                    vertix3 = meshExpl[ index1 ][ index2 ].Vertices[2]
                    vertix4 = meshExpl[index1 + 1 ][ index2].Vertices[1]
                    vertix5 = meshExpl[index1 + 1 ][ index2].Vertices[2]
                    
                    vertixEle1 = [ vertix1, vertix2, vertix3, vertix4 ]
                    vertixEle2 = [ vertix1, vertix2, vertix3, vertix2 ]
                    
                    ele1 = rg.Mesh() # Tetrahedron 1
                    ele2 = rg.Mesh() # Tetrahedron 2
                    
                    ele1.Vertices.Add( vertix1 ) # 0 
                    ele1.Vertices.Add( vertix2 ) # 1
                    ele1.Vertices.Add( vertix3 ) # 2 
                    ele1.Vertices.Add( vertix4 ) # 3 
                    
                    ele1.VertexColors.Add(color)
                    ele1.VertexColors.Add(color)
                    ele1.VertexColors.Add(color)
                    ele1.VertexColors.Add(color)
                    
                    ele2.Vertices.Add( vertix1 ) # 0 
                    ele2.Vertices.Add( vertix2 ) # 1 
                    ele2.Vertices.Add( vertix3 ) # 2 
                    ele2.Vertices.Add( vertix2 ) # 3
    
                    ele2.VertexColors.Add(color)
                    ele2.VertexColors.Add(color)
                    ele2.VertexColors.Add(color)
                    ele2.VertexColors.Add(color)
                    
                    ele1.Faces.AddFace(0, 1, 4 ) # 0
                    ele1.Faces.AddFace(0, 1, 3 ) # 1
                    ele1.Faces.AddFace(0, 4, 3 ) # 2
                    ele1.Faces.AddFace(1, 3, 4 ) # 3
                    
                    ele2.Faces.AddFace(0, 1, 3 ) # 0
                    ele2.Faces.AddFace(0, 1, 2 ) # 1
                    ele2.Faces.AddFace(1, 2, 3 ) # 2
                    ele2.Faces.AddFace(0, 2, 3 ) # 3
                    
                    ele = [ ele1, ele2 ]
                    
                else :
                
                    vertix1 = meshExpl[ index1 ][ index2 ].Vertices[0]
                    vertix2 = meshExpl[ index1 ][ index2 ].Vertices[1]
                    vertix3 = meshExpl[ index1 ][ index2 ].Vertices[2]
                    vertix4 = meshExpl[index1 + 1 ][ index2].Vertices[0]
                    vertix5 = meshExpl[index1 + 1 ][ index2].Vertices[1]
                    vertix6 = meshExpl[index1 + 1 ][ index2].Vertices[2]
                    
                    vertixEle1 = [ vertix1, vertix2, vertix3, vertix6 ]
                    vertixEle2 = [ vertix4, vertix5, vertix6, vertix1 ]
                    vertixEle3 = [ vertix5, vertix6, vertix2, vertix1 ]
                    
                    vertix = [ vertixEle1, vertixEle2, vertixEle3 ]
                    
                    ele1 = rg.Mesh() # Tetrahedron 1
                    ele2 = rg.Mesh() # Tetrahedron 2
                    ele3 = rg.Mesh() # Tetrahedron 3
                    
                    ele1.Vertices.Add( vertix1 ) # 0 
                    ele1.Vertices.Add( vertix2 ) # 1
                    ele1.Vertices.Add( vertix3 ) # 2 
                    ele1.Vertices.Add( vertix6 ) # 3 
                    
                    ele1.VertexColors.Add(color)
                    ele1.VertexColors.Add(color)
                    ele1.VertexColors.Add(color)
                    ele1.VertexColors.Add(color)
                    
                    ele2.Vertices.Add( vertix4 ) # 0 
                    ele2.Vertices.Add( vertix5 ) # 1 
                    ele2.Vertices.Add( vertix6 ) # 2 
                    ele2.Vertices.Add( vertix1 ) # 3
    
                    ele2.VertexColors.Add(color)
                    ele2.VertexColors.Add(color)
                    ele2.VertexColors.Add(color)
                    ele2.VertexColors.Add(color)
                    
                    ele3.Vertices.Add( vertix5 ) # 0 
                    ele3.Vertices.Add( vertix6 ) # 1 
                    ele3.Vertices.Add( vertix2 ) # 2 
                    ele3.Vertices.Add( vertix1 ) # 3
                    
                    ele3.VertexColors.Add(color)
                    ele3.VertexColors.Add(color)
                    ele3.VertexColors.Add(color)
                    ele3.VertexColors.Add(color)
                    
                    ele1.Faces.AddFace(0, 1, 2 ) # 0
                    ele1.Faces.AddFace(0, 3, 1 ) # 1
                    ele1.Faces.AddFace(0, 3, 2 ) # 2
                    ele1.Faces.AddFace(1, 3, 2 ) # 3
                    
                    ele2.Faces.AddFace(0, 1, 2 ) # 0
                    ele2.Faces.AddFace(0, 3, 1 ) # 1
                    ele2.Faces.AddFace(0, 3, 2 ) # 2
                    ele2.Faces.AddFace(1, 3, 2 ) # 3
                    
                    ele3.Faces.AddFace(0, 1, 2 ) # 0
                    ele3.Faces.AddFace(0, 3, 1 ) # 1
                    ele3.Faces.AddFace(0, 3, 2 ) # 2
                    ele3.Faces.AddFace(1, 3, 2 ) # 3
                    
                    ele = [ ele1, ele2, ele3 ]
            
            solid.append(ele)
            Vertix.append( vertix )
            '''
    return solid

checkData = True

if not MeshSeries or len(MeshSeries) == 1 :  #is not None:
    checkData = False
    msg = "input 'MeshSeries' failed to collect data"
    ghenv.Component.AddRuntimeMessage( gh.Kernel.GH_RuntimeMessageLevel.Warning, msg )

if checkData != False:
    Brick= brick( MeshSeries )
# ---------- end mstb ----------
data_3 = Data(nv_2.NakedPts)
data_4 = Data(nv_3.NakedPts)
pline_4 = PolyLine(Vertices=nv_2.NakedPts, Closed=False)
fcircle_2 = CircleFit(Points=data_3)  # -> Circle, Radius, Deviation
fcircle_3 = CircleFit(Points=data_4)  # -> Circle, Radius, Deviation
alongcrv_2 = SortAlongCurve(Points=data_3, Curve=fcircle_2.Circle)  # -> Points, Indices
alongcrv_3 = SortAlongCurve(Points=data_4, Curve=fcircle_3.Circle)  # -> Points, Indices
pline_5 = PolyLine(Vertices=alongcrv_2.Points, Closed=Toggle(True))  # -> reparameterize(Polyline)
pline_6 = PolyLine(Vertices=alongcrv_3.Points, Closed=Toggle(True))  # -> reparameterize(Polyline)
explode_6 = Explode(Curve=pline_5, Recursive=True)  # -> Segments, Vertices
explode_7 = Explode(Curve=pline_6, Recursive=True)  # -> Segments, Vertices
entwine = Entwine(Branch00=explode_7.Segments, Branch01=explode_6.Segments, FlattenInputs=True)
flip_5 = FlipMatrix(Data=entwine)
loft_2 = Loft(Curves=flip_5, Options={Adjust=False, Closed=False, LoftEnds=0, LoftSimp=0, LoftType=0, Rebuild=10, Refit=0.01})
smesh = SimpleMesh(Brep=loft_2)
mjoin_2 = MeshJoin(Meshes=flatten([smesh, item_2.Item1, move_5.Geometry]))
clean_2 = CombineClean(Meshes=mjoin_2)
tetgen = Tetrahedralize(Mesh=clean_2, Flags="0", MinRatio=Slider(64, range=0..100))  # -> Mesh, Indices, Points
demesh = DeconstructMesh(Mesh=tetgen.Mesh)  # -> flatten(Vertices), Faces, Colours, Normals
duppt_4 = RemoveDuplicatePts(Points=demesh.Vertices, Tolerance=0.01)
pdecon = Deconstruct(Point=duppt_4)  # -> XComponent, YComponent, ZComponent
bnd = Bounds(Numbers=pdecon.ZComponent)
dedomain = DeconstructDomain(Domain=bnd)  # -> Start, End
smaller = SmallerThan(FirstNumber=dedomain.Start, SecondNumber=pdecon.ZComponent)  # -> SmallerThan, OrEqualTo
not = GateNot(A=smaller.SmallerThan)
cull = CullPattern(List=duppt_4, CullPattern=not)

load = Data(duppt_2)
travi = Data(dupln)
column = Data(flip_3)
brick = Data(mstb)
solaio = Data(turn)
tetraedri = Data(tetgen.Mesh)
support = Data(cull)

uem = UniaxialElasticMaterialAlpaca4d(E="21000", G="21000", v="0.3", rho="78")  # -> out, uniAxialMaterial
# ---------- uem: Python ----------
"""
Create a uniaxial Elastic Material
-
    Args:
        E:
        Eneg:
        eta:
        G:
        v:
        rho:
    Returns:
        uniAxialMaterial:
"""

ghenv.Component.Name = "uniaxial Elastic Material (Alpaca4d)"
ghenv.Component.NickName = 'UEM'
ghenv.Component.Message = "uniaxial Elastic (Alpaca4d)"

import sys
import Rhino.Geometry as rg
import Grasshopper as gh
import copy


## add alpaca install directory to system path

ghcompfolder = gh.Folders.DefaultAssemblyFolder
if ghcompfolder not in sys.path:
    sys.path.append(ghcompfolder)

try:
    from Alpaca4d import alpaca4d as alpaca
except:
    msg = "Cannot import Alpaca4d. Is the Alpaca4d folder available in " + ghcompfolder + "?"
    ghenv.Component.AddRuntimeMessage(gh.Kernel.GH_RuntimeMessageLevel.Error, msg)


checkData = True

if not E:
    checkData = False
    msg = "Input parameter E failed to collect data"
    ghenv.Component.AddRuntimeMessage(gh.Kernel.GH_RuntimeMessageLevel.Warning, msg)

if not G and not v:
    checkData = False
    msg = "Input parameter G or v failed to collect data"
    ghenv.Component.AddRuntimeMessage(gh.Kernel.GH_RuntimeMessageLevel.Warning, msg)

if not rho:
    checkData = False
    msg = "Input parameter rho failed to collect data"
    ghenv.Component.AddRuntimeMessage(gh.Kernel.GH_RuntimeMessageLevel.Warning, msg)



if checkData:
    uniAxialMaterial = alpaca.uniAxialMaterialElastic(name, E, Eneg, eta, G, v, rho)
# ---------- end uem ----------
rs = RectangularSectionAlpaca4d(b="0.6", h="0.3", material=uem.uniAxialMaterial)  # -> out, Section
# ---------- rs: Python ----------
"""
Create a Rectangular Cross Section
-
    Args:
        secName:
        Area:
        Izz:
        Iyy:
        J:
        alphaY:
        alphaZ:
        material:
    Returns:
        Section:
"""
ghenv.Component.Name = "Rectangular Section (Alpaca4d)"
ghenv.Component.NickName = 'RS'
ghenv.Component.Message = "Rectangular Section (Alpaca4d)"

import sys
import Rhino.Geometry as rg
import Grasshopper as gh
import copy


## add alpaca install directory to system path

ghcompfolder = gh.Folders.DefaultAssemblyFolder
if ghcompfolder not in sys.path:
    sys.path.append(ghcompfolder)

try:
    from Alpaca4d import alpaca4d as alpaca
except:
    msg = "Cannot import Alpaca4d. Is the Alpaca4d folder available in " + ghcompfolder + "?"
    ghenv.Component.AddRuntimeMessage(gh.Kernel.GH_RuntimeMessageLevel.Error, msg)


checkData = True

if not b:
    checkData = False
    msg = "Input parameter b failed to collect data"
    ghenv.Component.AddRuntimeMessage(gh.Kernel.GH_RuntimeMessageLevel.Warning, msg)

if not h:
    checkData = False
    msg = "Input parameter h failed to collect data"
    ghenv.Component.AddRuntimeMessage(gh.Kernel.GH_RuntimeMessageLevel.Warning, msg)

if not material:
    checkData = False
    msg = "Input parameter material failed to collect data"
    ghenv.Component.AddRuntimeMessage(gh.Kernel.GH_RuntimeMessageLevel.Warning, msg)



if checkData:
    rectCS = alpaca.RectangularCS(b,h,material)
    Section = alpaca.ElasticSection(secName, rectCS.Area(), rectCS.Izz(), rectCS.Iyy(), rectCS.J(), rectCS.alphaY, rectCS.alphaZ, rectCS.material)
    Section.crv = rectCS.crv
    Section.sectionBrep = rectCS.sectionBrep
# ---------- end rs ----------
cs = CircularSectionAlpaca4d(d="0.6", t="0.3", material=uem.uniAxialMaterial)  # -> out, Section
# ---------- cs: Python ----------
"""
Create a Circle Cross Section
-
    Args:
        secName:
        Area:
        Izz:
        Iyy:
        J:
        alphaY:
        alphaZ:
        material:
    Returns:
        genericSection:
"""

ghenv.Component.Name = "Circular Section (Alpaca4d)"
ghenv.Component.NickName = 'CS'
ghenv.Component.Message = "Circular Section (Alpaca4d)"

import sys
import Rhino.Geometry as rg
import Grasshopper as gh
import copy


## add alpaca install directory to system path

ghcompfolder = gh.Folders.DefaultAssemblyFolder
if ghcompfolder not in sys.path:
    sys.path.append(ghcompfolder)

try:
    from Alpaca4d import alpaca4d as alpaca
except:
    msg = "Cannot import Alpaca4d. Is the Alpaca4d folder available in " + ghcompfolder + "?"
    ghenv.Component.AddRuntimeMessage(gh.Kernel.GH_RuntimeMessageLevel.Error, msg)


checkData = True

if not d:
    checkData = False
    msg = "Input parameter d failed to collect data"
    ghenv.Component.AddRuntimeMessage(gh.Kernel.GH_RuntimeMessageLevel.Warning, msg)

if not t:
    checkData = False
    msg = "Input parameter t failed to collect data"
    ghenv.Component.AddRuntimeMessage(gh.Kernel.GH_RuntimeMessageLevel.Warning, msg)

if not material:
    checkData = False
    msg = "Input parameter material failed to collect data"
    ghenv.Component.AddRuntimeMessage(gh.Kernel.GH_RuntimeMessageLevel.Warning, msg)



if checkData:
    circleCS = alpaca.CircleCS(d,t,material)
    Section = alpaca.ElasticSection(secName, circleCS.Area(), circleCS.Izz(), circleCS.Iyy(), circleCS.J(), circleCS.alphaY, circleCS.alphaZ, circleCS.material)
    Section.crv = circleCS.crv
    Section.sectionBrep = circleCS.sectionBrep
# ---------- end cs ----------
eim = ElasticIsotropicMaterialAlpaca4d(E="10000", G="10000", v="0.3", rho="78")  # -> out, nDMaterial
# ---------- eim: Python ----------
"""
Create a nD Elastic Isotropic Material
-
    Args:
        name:
        E:
        G:
        v:
        rho:
    Returns:
        nDMaterial:
"""

ghenv.Component.Name = "Elastic Isotropic Material (Alpaca4d)"
ghenv.Component.NickName = 'EIM'
ghenv.Component.Message = "Elastic Isotropic (Alpaca4d)"


import sys
import Rhino.Geometry as rg
import Grasshopper as gh
import copy


## add alpaca install directory to system path

ghcompfolder = gh.Folders.DefaultAssemblyFolder
if ghcompfolder not in sys.path:
    sys.path.append(ghcompfolder)

try:
    from Alpaca4d import alpaca4d as alpaca
except:
    msg = "Cannot import Alpaca4d. Is the Alpaca4d folder available in " + ghcompfolder + "?"
    ghenv.Component.AddRuntimeMessage(gh.Kernel.GH_RuntimeMessageLevel.Error, msg)


checkData = True

if not E:
    checkData = False
    msg = "Input parameter E failed to collect data"
    ghenv.Component.AddRuntimeMessage(gh.Kernel.GH_RuntimeMessageLevel.Warning, msg)

if not G and not v:
    checkData = False
    msg = "Input parameter G or v failed to collect data"
    ghenv.Component.AddRuntimeMessage(gh.Kernel.GH_RuntimeMessageLevel.Warning, msg)

if not rho:
    checkData = False
    msg = "Input parameter rho failed to collect data"
    ghenv.Component.AddRuntimeMessage(gh.Kernel.GH_RuntimeMessageLevel.Warning, msg)

if checkData:
    nDMaterial = alpaca.ElasticIsotropic(name, E, G, rho, v)
# ---------- end eim ----------
cts = ConstantTimeSeriesAlpaca4d(constantFactor="1")  # -> TimeSeries, Graph
# ---------- cts: Python ----------
"""
Create a Constant Time Series
-
    Args:
        tStart:
        tEnd:
        period:
        factor:
        shift:
    Returns:
        TimeSeries:
        Graph:
"""

ghenv.Component.Name = "Constant Time Series (Alpaca4d)"
ghenv.Component.NickName = 'CTS'
ghenv.Component.Message = "Constant Time Series (Alpaca4d)"


import sys
import Rhino.Geometry as rg
import Grasshopper as gh
import copy
import math


## add alpaca install directory to system path

ghcompfolder = gh.Folders.DefaultAssemblyFolder
if ghcompfolder not in sys.path:
    sys.path.append(ghcompfolder)

try:
    from Alpaca4d import alpaca4d as alpaca
except:
    msg = "Cannot import Alpaca4d. Is the Alpaca4d folder available in " + ghcompfolder + "?"
    ghenv.Component.AddRuntimeMessage(gh.Kernel.GH_RuntimeMessageLevel.Error, msg)

def ConstantSeries(x):
    return x



checkData = True

if not constantFactor:
    constantFactor = 1


if checkData:
    TimeSeries = alpaca.TimeSeriesConstant(constantFactor)
    
    Graph = []
    
    for x in range(10):
        Graph.append(ConstantSeries(constantFactor))
# ---------- end cts ----------
pfs = PlateFiberAlpaca4d(thickness="0.3", nDMaterial=eim.nDMaterial)  # -> out, Section
# ---------- pfs: Python ----------
"""
Create a Plate Fiber Section
-
    Args:
        secName:
        thickness:
        nDMaterial:
    Returns:
        Section:
"""


import sys
import Rhino.Geometry as rg
import Grasshopper as gh
import copy

ghenv.Component.Name = "Plate Fiber (Alpaca4d)"
ghenv.Component.NickName = 'PFS'
ghenv.Component.Message = "Plate Fiber (Alpaca4d)"


## add alpaca install directory to system path

ghcompfolder = gh.Folders.DefaultAssemblyFolder
if ghcompfolder not in sys.path:
    sys.path.append(ghcompfolder)

try:
    from Alpaca4d import alpaca4d as alpaca
except:
    msg = "Cannot import Alpaca4d. Is the Alpaca4d folder available in " + ghcompfolder + "?"
    ghenv.Component.AddRuntimeMessage(gh.Kernel.GH_RuntimeMessageLevel.Error, msg)


checkData = True

if not thickness:
    checkData = False
    msg = "Input parameter thickness failed to collect data"
    ghenv.Component.AddRuntimeMessage(gh.Kernel.GH_RuntimeMessageLevel.Warning, msg)

if not nDMaterial:
    checkData = False
    msg = "Input parameter nDMaterial failed to collect data"
    ghenv.Component.AddRuntimeMessage(gh.Kernel.GH_RuntimeMessageLevel.Warning, msg)

if checkData:
    Section = alpaca.PlateFiberSection(secName, thickness, nDMaterial)
# ---------- end pfs ----------
toggle = BooleanToggle(True)
vec = VectorXYZ(XComponent="150", YComponent=0, ZComponent=0)  # -> Vector, Length
fbc = ForceBeamColumnAlpaca4d(Line=flatten(travi), Section=rs.Section, Colour=ColourSwatch(SwatchColor=RGB(255, 163, 163)))  # -> out, flatten(Element); inputs Line: Curve, Colour: Color
# ---------- fbc: Python ----------
"""
Create a Force Beam Column
-
    Args:
        Line:
        Section:
        Colour:
        Orient:
    Returns:
        Element:
"""

ghenv.Component.Name = "Force Beam Column (Alpaca4d)"
ghenv.Component.NickName = 'FBC'
ghenv.Component.Message = "Force Beam Column (Alpaca4d)"


import sys
import Rhino.Geometry as rg
import Grasshopper as gh
import copy
from System.Drawing import Color

## add alpaca install directory to system path

ghcompfolder = gh.Folders.DefaultAssemblyFolder
if ghcompfolder not in sys.path:
    sys.path.append(ghcompfolder)

try:
    from Alpaca4d import alpaca4d as alpaca
except:
    msg = "Cannot import Alpaca4d. Is the Alpaca4d folder available in " + ghcompfolder + "?"
    ghenv.Component.AddRuntimeMessage(gh.Kernel.GH_RuntimeMessageLevel.Error, msg)


checkData = True

if not Line:
    checkData = False
    msg = "Input parameter Line failed to collect data"
    ghenv.Component.AddRuntimeMessage(gh.Kernel.GH_RuntimeMessageLevel.Warning, msg)


if not Section:
    checkData = False
    msg = "Input parameter Section failed to collect data"
    ghenv.Component.AddRuntimeMessage(gh.Kernel.GH_RuntimeMessageLevel.Warning, msg)

if not Colour:
    Colour = Color.Red

if not Orient:
    Orient = 0.0


if checkData:
    newCrossSection = copy.deepcopy(Section)
    Element = alpaca.ForceBeamColumn(Line, newCrossSection, Colour, Orient)
# ---------- end fbc ----------
fbc_2 = ForceBeamColumnAlpaca4d(Line=column, Section=cs.Section, Colour=ColourSwatch(SwatchColor=RGB(143, 255, 234)))  # -> out, flatten(Element); inputs Line: Curve, Colour: Color; same code as fbc
stdb = StdBrickAlpaca4d(Brick=brick, nDMaterial=eim.nDMaterial)  # -> out, Element; inputs Brick: Mesh, Colour: Color
# ---------- stdb: Python ----------
"""
Create a Standard Brick (stdBrick)
-
    Args:
        Brick:
        nDMaterial:
        Colour:
    Returns:
        Element:
"""

ghenv.Component.Name = "std Brick (Alpaca4d)"
ghenv.Component.NickName = 'STDB'
ghenv.Component.Message = "std Brick (Alpaca4d)"


import sys
import Rhino.Geometry as rg
import Grasshopper as gh
import copy
from System.Drawing import Color


## add alpaca install directory to system path

ghcompfolder = gh.Folders.DefaultAssemblyFolder
if ghcompfolder not in sys.path:
    sys.path.append(ghcompfolder)

try:
    from Alpaca4d import alpaca4d as alpaca
except:
    msg = "Cannot import Alpaca4d. Is the Alpaca4d folder available in " + ghcompfolder + "?"
    ghenv.Component.AddRuntimeMessage(gh.Kernel.GH_RuntimeMessageLevel.Error, msg)


checkData = True

if not Brick:
    checkData = False
    msg = "Input parameter Brick failed to collect data"
    ghenv.Component.AddRuntimeMessage(gh.Kernel.GH_RuntimeMessageLevel.Warning, msg)

if not nDMaterial:
    checkData = False
    msg = "Input parameter nDMaterial failed to collect data"
    ghenv.Component.AddRuntimeMessage(gh.Kernel.GH_RuntimeMessageLevel.Warning, msg)

if not Colour:
    Colour = Color.DarkOrange


if checkData:
    #Brick = alpacaUtil.cleanHexahedron(Brick)
    Element = alpaca.stdBrick(Brick,copy.deepcopy(nDMaterial), Colour)
# ---------- end stdb ----------
ssp = SSPBrickAlpaca4d(Colour=ColourSwatch(SwatchColor=RGB(255, 163, 163)))  # -> out, Element; inputs Brick: Mesh, Colour: Color
# ---------- ssp: Python ----------
"""
Create a Stabilized Single Point Brick (SSPbrick)
-
    Args:
        Brick:
        nDMaterial:
        Colour:
    Returns:
        element:
"""

ghenv.Component.Name = "SSP brick (Alpaca4d)"
ghenv.Component.NickName = 'SSP'
ghenv.Component.Message = "SSP brick (Alpaca4d)"


import sys
import Rhino.Geometry as rg
import Grasshopper as gh
import copy


## add alpaca install directory to system path

ghcompfolder = gh.Folders.DefaultAssemblyFolder
if ghcompfolder not in sys.path:
    sys.path.append(ghcompfolder)

try:
    from Alpaca4d import alpaca4d as alpaca
except:
    msg = "Cannot import Alpaca4d. Is the Alpaca4d folder available in " + ghcompfolder + "?"
    ghenv.Component.AddRuntimeMessage(gh.Kernel.GH_RuntimeMessageLevel.Error, msg)


checkData = True

if not Brick:
    checkData = False
    msg = "Input parameter Brick failed to collect data"
    ghenv.Component.AddRuntimeMessage(gh.Kernel.GH_RuntimeMessageLevel.Warning, msg)

if not nDMaterial:
    checkData = False
    msg = "Input parameter nDMaterial failed to collect data"
    ghenv.Component.AddRuntimeMessage(gh.Kernel.GH_RuntimeMessageLevel.Warning, msg)


if checkData:
    Element = alpaca.SSPbrick(Brick,copy.deepcopy(nDMaterial), Colour)
# ---------- end ssp ----------
pl = PointLoadAlpaca4d(Pos=load, Force=vec.Vector, TimeSeries=cts.TimeSeries)  # -> out, Load; inputs Pos: Point3d, Force: Vector3d, Moment: Vector3d
# ---------- pl: Python ----------
"""
Create a Point Load
-
    Args:
        Pos:
        Force:
        Moment:
        TimeSeries:
    Returns:
        PointLoad:
"""

ghenv.Component.Name = "Point Load (Alpaca4d)"
ghenv.Component.NickName = 'PL'
ghenv.Component.Message = "Point Load (Alpaca4d)"



import sys
import Rhino.Geometry as rg
import Grasshopper as gh
import copy


## add alpaca install directory to system path

ghcompfolder = gh.Folders.DefaultAssemblyFolder
if ghcompfolder not in sys.path:
    sys.path.append(ghcompfolder)

try:
    from Alpaca4d import alpaca4d as alpaca
except:
    msg = "Cannot import Alpaca4d. Is the Alpaca4d folder available in " + ghcompfolder + "?"
    ghenv.Component.AddRuntimeMessage(gh.Kernel.GH_RuntimeMessageLevel.Error, msg)


checkData = True

if not Pos:
    checkData = False
    msg = "Input parameter Pos failed to collect data"
    ghenv.Component.AddRuntimeMessage(gh.Kernel.GH_RuntimeMessageLevel.Warning, msg)

if not Force:
    Force = rg.Vector3d(0,0,0)

if not Moment:
    Moment = rg.Vector3d(0,0,0)

if not TimeSeries:
    checkData = False
    msg = "Input parameter TimeSeries failed to collect data"
    ghenv.Component.AddRuntimeMessage(gh.Kernel.GH_RuntimeMessageLevel.Warning, msg)


if checkData:
    Load = alpaca.PointLoad(Pos, Force, Moment, TimeSeries)
# ---------- end pl ----------
fnt = FourNodeTetrahedronAlpaca4d(Tetrahedron=tetraedri, nDMaterial=eim.nDMaterial, Colour=ColourSwatch(SwatchColor=RGB(255, 99, 99)))  # -> out, Element; inputs Tetrahedron: Mesh, Colour: Color
# ---------- fnt: Python ----------
"""
Create a Four Node Tetrahedron Element
-
    Args:
        Tetrahedron:
        nDMaterial:
        Colour:
    Returns:
        Element:
"""

ghenv.Component.Name = "Four Node Tetrahedron (Alpaca4d)"
ghenv.Component.NickName = 'FNT'
ghenv.Component.Message = "Tetrahedron (Alpaca4d)"


import sys
import Rhino.Geometry as rg
import Grasshopper as gh
import copy


## add alpaca install directory to system path

ghcompfolder = gh.Folders.DefaultAssemblyFolder
if ghcompfolder not in sys.path:
    sys.path.append(ghcompfolder)

try:
    from Alpaca4d import alpaca4d as alpaca
except:
    msg = "Cannot import Alpaca4d. Is the Alpaca4d folder available in " + ghcompfolder + "?"
    ghenv.Component.AddRuntimeMessage(gh.Kernel.GH_RuntimeMessageLevel.Error, msg)


checkData = True

if not Tetrahedron:
    checkData = False
    msg = "Input parameter Tetrahedron failed to collect data"
    ghenv.Component.AddRuntimeMessage(gh.Kernel.GH_RuntimeMessageLevel.Warning, msg)

if not nDMaterial:
    checkData = False
    msg = "Input parameter nDMaterial failed to collect data"
    ghenv.Component.AddRuntimeMessage(gh.Kernel.GH_RuntimeMessageLevel.Warning, msg)


if checkData:
    Element = alpaca.FourNodeTetrahedron(Tetrahedron,copy.deepcopy(nDMaterial), Colour)
# ---------- end fnt ----------
mitc4 = ShellMITC4Alpaca4d(Mesh=solaio, Section=pfs.Section)  # -> out, Element; inputs Mesh: Mesh, Colour: Color
# ---------- mitc4: Python ----------
"""
Create a ShellMITC4 element
-
    Args:
        Mesh:
        Section:
        Colour:
    Returns:
        Element:
"""

ghenv.Component.Name = "Shell MITC4 (Alpaca4d)"
ghenv.Component.NickName = 'MITC4'
ghenv.Component.Message = "ShellMITC4 (Alpaca4d)"



import sys
import Rhino.Geometry as rg
import Grasshopper as gh
import copy
from System.Drawing import Color


## add alpaca install directory to system path

ghcompfolder = gh.Folders.DefaultAssemblyFolder
if ghcompfolder not in sys.path:
    sys.path.append(ghcompfolder)

try:
    from Alpaca4d import alpaca4d as alpaca
except:
    msg = "Cannot import Alpaca4d. Is the Alpaca4d folder available in " + ghcompfolder + "?"
    ghenv.Component.AddRuntimeMessage(gh.Kernel.GH_RuntimeMessageLevel.Error, msg)


checkData = True

if not Mesh:
    checkData = False
    msg = "Input parameter Mesh failed to collect data"
    ghenv.Component.AddRuntimeMessage(gh.Kernel.GH_RuntimeMessageLevel.Warning, msg)

if not Section:
    checkData = False
    msg = "Input parameter Section failed to collect data"
    ghenv.Component.AddRuntimeMessage(gh.Kernel.GH_RuntimeMessageLevel.Warning, msg)

if not Colour:
    Colour = Color.Blue


if checkData:
    
    Mesh.Unweld(0,True)
    explodedMesh = Mesh.ExplodeAtUnweldedEdges()
    if explodedMesh.Length > 0:
        Element = []
        for mesh in explodedMesh:
            if mesh.Vertices.Count == 4:
                Element.append(alpaca.ShellMITC4(mesh, copy.deepcopy(Section), Colour))
            elif mesh.Vertices.Count == 3:
                Element.append(alpaca.ShellNLDKGT(mesh, copy.deepcopy(Section), Colour))
    elif explodedMesh.Length == 0:
        if Mesh.Vertices.Count == 4:
                Element = alpaca.ShellMITC4(Mesh, copy.deepcopy(Section), Colour)
        elif Mesh.Vertices.Count == 3:
            Element = alpaca.ShellNLDKGT(Mesh, copy.deepcopy(Section), Colour)
# ---------- end mitc4 ----------
support_2 = SupportAlpaca4d(Pos=support, Tx=toggle, Ty=toggle, Tz=toggle, Rx=toggle, Ry=toggle, Rz=toggle)  # -> Support; inputs Pos: Point3d, Tx: Boolean, Ty: Boolean, Tz: Boolean, Rx: Boolean, Ry: Boolean, Rz: Boolean
# ---------- support_2: Python ----------
"""
Create a support
-
    Args:
        Pos:
        Tx:
        Ty:
        Tz:
        Rx:
        Ry:
    Returns:
        Support:
"""

ghenv.Component.Name = "Support (Alpaca4d)"
ghenv.Component.NickName = 'Support'
ghenv.Component.Message = "Support (Alpaca4d)"


import sys
import Rhino.Geometry as rg
import Grasshopper as gh


## add alpaca install directory to system path

ghcompfolder = gh.Folders.DefaultAssemblyFolder
if ghcompfolder not in sys.path:
    sys.path.append(ghcompfolder)

try:
    from Alpaca4d import alpaca4d as alpaca
except:
    msg = "Cannot import Alpaca4d. Is the Alpaca4d folder available in " + ghcompfolder + "?"
    ghenv.Component.AddRuntimeMessage(gh.Kernel.GH_RuntimeMessageLevel.Error, msg)

checkData = True


if not Pos:
    checkData = False
    msg = "Input parameter Pos failed to collect data"
    ghenv.Component.AddRuntimeMessage(gh.Kernel.GH_RuntimeMessageLevel.Warning, msg)

if checkData:
    Support = alpaca.Support(Pos, Tx, Ty, Tz, Rx, Ry, Rz)
# ---------- end support_2 ----------
am = AssembleModelAlpaca4d(Element=flatten([fbc_2.Element, fbc.Element, stdb.Element, mitc4.Element]), Support=support_2, Load=flatten(pl.Load))  # -> out, AlpacaModel, Mass; inputs Element: list, Support: list, Load: list, Constraint: list
# ---------- am: Python ----------
"""
Create a FEA Model
-
    Args:
        Element:
        Support:
        Load:
        Constraint:
    Returns:
        AlpacaModel:
"""

ghenv.Component.Name = "Assemble Model (Alpaca4d)"
ghenv.Component.NickName = 'AM'
ghenv.Component.Message = "Assemble Model (Alpaca4d)"




import os
from Alpaca4d import alpaca4d as alpaca
import ghpythonlib.treehelpers as th
import Rhino.Geometry as rg
import Rhino.Collections as rc
import rhinoscriptsyntax as rs
from collections import defaultdict, OrderedDict
import copy
import time



FolderPath = rs.DocumentPath()
os.chdir(FolderPath)

# create the object model
AlpacaModel = alpaca.Model()


start = time.clock()
#subdivide element per type

for element in Element:
    if element.type == "Beam":
        AlpacaModel.beams.append(element)
    elif element.type == "Shell":
        AlpacaModel.shells.append(element)
    elif element.type == "Brick":
        AlpacaModel.bricks.append(element)

end = time.clock() - start
print("time to subdivide element {}".format(end))
start = time.clock()

# create a list of unique point
# need to add the rigid constraint

AlpacaModel.getuniquePoints(AlpacaModel.beams, AlpacaModel.shells, AlpacaModel.bricks, AlpacaModel.constraints)


end = time.clock() - start
print("time to get uniquepoints {}".format(end))
start = time.clock()


#############
# create node and assign to object
#############

if AlpacaModel.uniquePointsThreeNDF:
    AlpacaModel.py.append(alpaca.Model.write3ndf_tcl())
    for point in AlpacaModel.uniquePointsThreeNDF:
        node = alpaca.Node(point)
        node.ndf = 3
        node.setNodeTag(AlpacaModel)
        AlpacaModel.nodes.append( node )
    
        AlpacaModel.py.append(node.write_tcl())


if AlpacaModel.uniquePointsSixNDF:
    AlpacaModel.py.append(alpaca.Model.write6ndf_tcl())
    for point in AlpacaModel.uniquePointsSixNDF:
        node = alpaca.Node(point)
        node.ndf = 6
        node.setNodeTag(AlpacaModel)
        AlpacaModel.nodes.append( node )
     
        AlpacaModel.py.append(node.write_tcl())



end = time.clock() - start
print("time to create node and assign tag {}".format(end))
start = time.clock()


#################
# create supports
#################

for supportNode in Support:
    
    # if the list is empty, skip this operation
    if AlpacaModel.uniquePointsThreeNDF:
        closestPointInThreeNDF = rc.Point3dList.ClosestPointInList(AlpacaModel.uniquePointsThreeNDF, supportNode.Pos)
        if supportNode.Pos.DistanceTo(closestPointInThreeNDF) < 0.001:
            #print("I am in 3ndf")
            supportNode.ndf = 3
            AlpacaModel.threeNDFModel.append(supportNode)
            supportNode.setNodeTag(AlpacaModel)
    
    if AlpacaModel.uniquePointsSixNDF:
        closestPointInSixNDF = rc.Point3dList.ClosestPointInList(AlpacaModel.uniquePointsSixNDF, supportNode.Pos)
        if supportNode.Pos.DistanceTo(closestPointInSixNDF) < 0.001:
            supportNode.ndf = 6
            AlpacaModel.sixNDFModel.append(supportNode)
            supportNode.setNodeTag(AlpacaModel)
    
    
    AlpacaModel.supports.append(supportNode)
    AlpacaModel.py.append(supportNode.write_tcl())


end = time.clock() - start
print("time to create support and assign tag {}".format(end))
start = time.clock()


####################
# create constraints
####################


for constraint in Constraint:
    constraint.setNodeTag(AlpacaModel)
    AlpacaModel.constraints.append(constraint)

####################
# create equalDOF when the model has 3df and 6df together
####################


end = time.clock() - start
print("time to create constraint and assign tag {}".format(end))
start = time.clock()


Id = []
IdB = []

def SearchCallback(sender, e):
    Id.Add(e.Id)
    IdB.Add(e.IdB)



lenThreeNDF = len(AlpacaModel.uniquePointsThreeNDF)
lenSixNDF = len(AlpacaModel.uniquePointsSixNDF)


if not(lenThreeNDF == 0 or lenSixNDF == 0):
    print("brick and beam together")
    rg.RTree.SearchOverlaps(AlpacaModel.RTreeCloudPointThreeNDF, AlpacaModel.RTreeCloudPointSixNDF, 0.001, SearchCallback)
    
    for i,j in zip(Id, IdB):
        print(i,j)
        node_i = AlpacaModel.uniquePointsThreeNDF[i]
        node_j = AlpacaModel.uniquePointsSixNDF[j]
        
        #index_i = AlpacaModel.cloudPoint.ClosestPoint(node_i) + 1
        #index_j = AlpacaModel.cloudPoint.ClosestPoint(node_j) + 1
        
        equalConstraint = alpaca.EqualDOF(node_i, node_j, True, True, True, False, False, False)
        equalConstraint.masterNodeTag = AlpacaModel.cloudPointThreeNDF.ClosestPoint(node_i) + 1
        equalConstraint.slaveNodesTag = AlpacaModel.cloudPointSixNDF.ClosestPoint(node_j) + 1 + len(AlpacaModel.uniquePointsThreeNDF)
        AlpacaModel.py.append(equalConstraint.write_tcl())



end = time.clock() - start
print("time to find common points between 3ndf and 6ndf {}".format(end))
start = time.clock()


# write py file


# assign tag and node Index to element and shell
for index, element in enumerate(Element,1):
    element.setTopologyRTree(AlpacaModel)
    element.eleTag = index
    element.setTags()



end = time.clock() - start
print("time to assign tags for the elements {}".format(end))
start = time.clock()



Mass = 0
IsGravity = False

for item in Load:
    if item.type == "Gravity Load":
        IsGravity = True
        GravityLoad = item
    if item.type == "PointLoad":
        AlpacaModel.loads.append(item)


for item in Element:
    if item.type == "Beam":
        length = item.Crv.GetLength()
        Mass += (item.massDens * length)
        if IsGravity:
            gravityPointLoad = alpaca.PointLoad(item.Crv.PointAtStart, rg.Vector3d(0,0, -(item.massDens * length / 2)) * GravityLoad.GravityFactor, rg.Vector3d(0,0,0), GravityLoad.TimeSeries)
            #print( -(item.massDens * length / 2))
            AlpacaModel.loads.append(gravityPointLoad)
    if item.type == "Shell":
        meshArea = rg.AreaMassProperties.Compute(item.Mesh).Area
        areaDensity = item.CrossSection.height * item.CrossSection.material.rho
        Mass += areaDensity * meshArea
        if IsGravity:
            for vertex in item.Mesh.Vertices.ToPoint3dArray():
                gravityPointLoad = alpaca.PointLoad(vertex, rg.Vector3d(0,0, -(areaDensity * meshArea/ len(item.Mesh.Vertices))) * GravityLoad.GravityFactor, rg.Vector3d(0,0,0), GravityLoad.TimeSeries)
                AlpacaModel.loads.append(gravityPointLoad)
    if item.type == "Brick":
        #print(type(item.Mesh))
        meshVolume = rg.VolumeMassProperties.Compute(item.Mesh).Volume
        density = item.material.rho 
        Mass += density * meshVolume
        if IsGravity:
            for vertex in item.Mesh.Vertices.ToPoint3dArray():
                gravityPointLoad = alpaca.PointLoad(vertex, rg.Vector3d(0,0, -(density * meshVolume / len(item.Mesh.Vertices))) * GravityLoad.GravityFactor, rg.Vector3d(0,0,0), GravityLoad.TimeSeries)
                #print(len(item.Mesh.Vertices))
                #print(density)
                # volume can be zero if mesh faces are not properly rotated
                #print(meshVolume)
                #print(-(density * meshVolume / len(item.Mesh.Vertices)))
                AlpacaModel.loads.append(gravityPointLoad)

#print(AlpacaModel.loads)
## load

for item in AlpacaModel.loads:
    item.setNodeTag(AlpacaModel)

#print(AlpacaModel.loads)

for item in AlpacaModel.beams:
    AlpacaModel.py.append(item.write_tcl())

for item in AlpacaModel.shells:
    AlpacaModel.py.append(item.write_tcl())

for item in AlpacaModel.bricks:
    AlpacaModel.py.append(item.write_tcl())


for item in Constraint:
    AlpacaModel.py.append(item.write_tcl())


timeSeriesDict = alpaca.TimeSeries.getTimeSeries(AlpacaModel.loads)[1]
AlpacaModel.py.append(alpaca.PointLoad.write_tcl(timeSeriesDict,AlpacaModel))
# ---------- end am ----------
as = AnalysisSettingsAlpaca4d(Algorithm="KrylovNewton", AnalysisSteps="3")  # -> out, Analysis
# ---------- as: Python ----------
"""
Create Analysis settings
-
    Args:
        Constraint: 'Plain', 'Transformation'. Default is 'Transformation'.
        Numberer: 'RCM', 'AMD', 'Plain'. Default is 'RCM'.
        System: 'BandGen', 'BandSPD', 'ProfileSPD', 'SuperLU', 'UmfPack', 'FullGeneral', 'SparseSYM'. Default is 'BandSPD'.
        Test: Feature not implemented. Please contact alpaca4d@gmail.com 
        Algorithm: 'Linear', 'Newton', 'NewtonLineSearch', 'ModifiedNewton', 'KrylovNewton', 'SecantNewton', 'BFGS', 'Broyden'. Default is 'Linear'.
        Integrator: Default is LoadControl.
        AnalysisType: 'Static', 'Transient'. Default is 'Static'.
        AnalyesSteps:
    Returns:
        Analysis:
"""

import sys
import os


import clr
import clrtype
import Rhino.Geometry as rg
import rhinoscriptsyntax as rs
import Grasshopper as gh
import copy
import ghpythonlib.treehelpers as th


ghenv.Component.Name = "Analysis settings (Alpaca4d)"
ghenv.Component.NickName = 'AS'
ghenv.Component.Message = "Settings (Alpaca4d)"



from Alpaca4d import alpaca4d as alpaca

checkData = True


# default Value
Constraint = 'Transformation' if Constraint is None else Constraint
ConstraintList = ['Plain', 'Transformation']

for item in ConstraintList:
    if Constraint.lower() == item.lower():
        print(item)
        Constraint = item


# default Value
Numberer = 'RCM' if Numberer is None else Numberer
NumbererList = ['RCM', 'AMD', 'Plain', 'ParallelPlain', 'ParallelRCM']

for i,item in enumerate(NumbererList):
    if Numberer.lower() == item.lower():
        Numberer = item



# default Value
System = 'BandSPD' if System is None else System
SystemList = ['BandGen', 'BandSPD', 'ProfileSPD', 'SuperLU', 'UmfPack', 'FullGeneral', 'SparseSYM']

for i,item in enumerate(SystemList):
    if System.lower() == item.lower():
        System = item


# default Test
Test = 'NormDispIncr 1.0e-6 12 5' if Test is None else Test




# default Value
Algorithm = 'Linear' if Algorithm is None else Algorithm
AlgorithmList = ['Linear', 'Newton', 'NewtonLineSearch', 'ModifiedNewton', 'KrylovNewton', 'SecantNewton', 'BFGS', 'Broyden']

for i,item in enumerate(AlgorithmList):
    if Algorithm.lower() == item.lower():
        Algorithm = item


# default Value
AnalysisType = 'Static' if AnalysisType is None else AnalysisType
AnalysisTypeList = ['Static', 'Transient']

for item in AnalysisTypeList:
    if AnalysisType.lower() == item.lower():
        AnalysisType = item


## Define Integrator
if AnalysisType == "Static":
    Integrator = "LoadControl 1.0" if Integrator is None else Integrator
elif AnalysisType == "Transien":
    Integrator = "Newmark 0.5 0.25" if Integrator is None else Integrator



if not AnalysisSteps:
    checkData = False
    msg = "Input parameter AnalysisSteps failed to collect data"
    ghenv.Component.AddRuntimeMessage(gh.Kernel.GH_RuntimeMessageLevel.Warning, msg)


if checkData:
    Analysis = alpaca.Analysis(Constraint, Numberer,System,Test,Algorithm,Integrator,AnalysisType, AnalysisSteps)
# ---------- end as ----------
panel_2 = Panel(am.out)
ra = RunAnalysisAlpaca4d(AlpacaModel=am.AlpacaModel, Analysis=as.Analysis)  # -> log, AlpacaSolvedModel
# ---------- ra: Python ----------
"""
Run an OpenSees Analysis
-
    Args:
        AlpacaModel:
        Analysis:
    Returns:
        AlpacaSolvedModel:
"""



import Rhino.RhinoDoc
import Grasshopper as gh
import copy
import rhinoscriptsyntax as rs
import os
import time
import sys



ghenv.Component.Name = "Run Analysis (Alpaca4d)"
ghenv.Component.NickName = 'RA'
ghenv.Component.Message = "Run Analysis (Alpaca4d)"

ghcompfolder = gh.Folders.DefaultAssemblyFolder
if ghcompfolder not in sys.path:
    sys.path.append(ghcompfolder)

try:
    from Alpaca4d import alpaca4d as alpaca
except:
    msg = "Cannot import Alpaca4d. Is the Alpaca4d folder available in " + ghcompfolder + "?"
    ghenv.Component.AddRuntimeMessage(gh.Kernel.GH_RuntimeMessageLevel.Error, msg)


checkData = True



if not AlpacaModel:
    checkData = False
    msg = "Input parameter AlpacaModel failed to collect data"
    ghenv.Component.AddRuntimeMessage(gh.Kernel.GH_RuntimeMessageLevel.Warning, msg)


if not Analysis:
    checkData = False
    msg = "Input parameter Analysis failed to collect data"
    ghenv.Component.AddRuntimeMessage(gh.Kernel.GH_RuntimeMessageLevel.Warning, msg)


if checkData:
    FolderPath = rs.DocumentPath()
    os.chdir(FolderPath)
    
    outputFileName = 'openSeesModel'
    
    for dirpath, dirnames, filenames in os.walk(FolderPath):
        for filename in filenames:
            if filename == outputFileName:
                file = os.path.join(dirpath,outputFileName)
                os.remove(file)
    
    
    # create a copy
    
    AnalysisModel = copy.copy(AlpacaModel)
    AnalysisModel.py = list(AnalysisModel.py)
    
    # generate Recorder and assign name
    AnalysisModel.recorderName = "recorder" + ".mpco"
    
    AnalysisModel.py.append(alpaca.TCLRecorder.mpco(AnalysisModel.recorderName, True,True,True,True,False,False,True,True,True,True))
    
    
    AnalysisModel.analysis = Analysis
    AnalysisModel.py.append(Analysis.write_tcl())
    AnalysisModel.py.append("wipe")
    
    
    #textFile = AnalysisModel.py
    
    time_start = time.clock()
    
    AnalysisModel.writeFile(outputFileName)
    
    time_elapsed = (time.clock() - time_start)
    print("Writing Time {}".format(time_elapsed))
    
    
    
    time_start = time.clock()
    
    executable = os.path.join(ghcompfolder,'Alpaca4d\OpenSees-Solvers\opensees.bat')
    a, log = AnalysisModel.runOpensees(executable)
    
    
    time_elapsed = (time.clock() - time_start)
    print("Analyses Time {}".format(time_elapsed))
    
    AlpacaSolvedModel = copy.copy(AnalysisModel)
    AlpacaSolvedModel.isAnalysed = True
# ---------- end ra ----------
toggle_2 = BooleanToggle(False)
toggle_3 = BooleanToggle(False)
toggle_4 = BooleanToggle(False)
toggle_5 = BooleanToggle(True)
toggle_6 = BooleanToggle(False)
bfd = BeamForcesDiagramAlpaca4d(
    AlpacaSolvedModel=ra.AlpacaSolvedModel,
    step=Slider(0, range=0..10),
    cdsType=Slider(1, range=0..10),
    scale=Slider(0.01, range=0..0.01),
    viewValor=Toggle(True))  # -> ForcesDiagram; inputs step: Int32, cdsType: Int32
# ---------- bfd: Python ----------
"""
View Diagram of internal beam forces

    Args:
        AlpacaModel:
        cdsType: 
    0: to view N (forces in direction 3)
    1: to view M2 (Moments around axis 2)
    2: to view T1 (forces in direction 1)
    3: to view M1 (Moments around axis 1)
    4: to view T2 (forces in direction 2)
    5: to view Mt (Moments around axis 3)
        step:
        scale: scalar view
        viewValor: to view tthe force value
    Returns:
        ForcesDiagram: Diagram of internal beam forces
"""


ghenv.Component.Name = "BeamForcesDiagram (Alpaca4d)"
ghenv.Component.NickName = 'BFD'
ghenv.Component.Message = "Beam Forces Diagram (Alpaca4d)"

from ghpythonlib.componentbase import executingcomponent as component
import Grasshopper, GhPython
import rhinoscriptsyntax as rs
import sys
import os
import System
import clr
import Rhino.Geometry as rg
import Grasshopper as gh
import copy
import Rhino


from Alpaca4d import alpaca4d as alpaca
from Alpaca4d import alpaca4dView as alpacaView
FolderPath = rs.DocumentPath()
os.chdir(FolderPath)

ghcompfolder = gh.Folders.DefaultAssemblyFolder
if ghcompfolder not in sys.path:
    sys.path.append(ghcompfolder)

# import costum modules to read the hdf5 file
my_module_name = "Alpaca_StepReader"
my_module = sys.modules.setdefault(my_module_name, type(sys)(my_module_name))

hdfFilePath = os.path.join(ghcompfolder, "Alpaca4d\HDF5CSharp.dll")
clr.AddReferenceToFileAndPath(hdfFilePath)

from HDF5CSharp import Hdf5

try:
    Steps = my_module.Steps
except AttributeError:
    type_2d = type(System.Array.CreateInstance(float, 1, 1))

    class Steps(object):
        __metaclass__ = clrtype.ClrClass
        _clrfields = {"STEP_{}".format(i): type_2d for i in range(1000)} # it will work for model with less than 1000 steps
    
    my_module.Steps = Steps

checkData = True

class MyComponent(component):
    
    def RunScript(self, AlpacaSolvedModel, step, cdsType, scale, viewValor):
        
        AlpacaSolvedModel = AlpacaSolvedModel
        step = step
        cdsType = cdsType
        scale = scale 
        viewValor = viewValor
            
        fileId = Hdf5.OpenFile(AlpacaSolvedModel.recorderName, True)
        
        stressResult = Hdf5.ReadObject[Steps](fileId, "/MODEL_STAGE[1]/RESULTS/ON_ELEMENTS/section.force/74-ForceBeamColumn3d[1000:1:0]/DATA")
        #stressResult = Hdf5.ReadObject[Steps](fileId, "/MODEL_STAGE[1]/RESULTS/ON_ELEMENTS/stresses/167-UnknownMovableObject[103:0:0]/DATA")
        if cdsType <= 0:
            versorType, startRange, colorPos, colorNeg = 1, 0, System.Drawing.Color.SteelBlue, System.Drawing.Color.LightSalmon
        elif cdsType == 1:
            versorType, startRange, colorPos, colorNeg = 1, 1, System.Drawing.Color.Aqua, System.Drawing.Color.IndianRed
        elif cdsType== 2:
            versorType, startRange, colorPos, colorNeg = 1, 2, System.Drawing.Color.LightSalmon, System.Drawing.Color.LightSalmon
        elif cdsType == 3:
            versorType, startRange, colorPos, colorNeg = 2, 3, System.Drawing.Color.SteelBlue, System.Drawing.Color.Yellow
        elif cdsType == 4:
            versorType, startRange, colorPos, colorNeg = 2, 4, System.Drawing.Color.LawnGreen, System.Drawing.Color.LawnGreen
        else:
            versorType, startRange, colorPos, colorNeg = 2, 5, System.Drawing.Color.BlueViolet, System.Drawing.Color.BlueViolet
            
        CDSView = []
        CDSPoint = []
        CDSValor = []
        
        for i,item in enumerate(AlpacaSolvedModel.beams):
            ni = 5 # potrebbe cambiare per ogni trave
            #Versore
            e = item.getPerpFrame()[versorType]*-1
            valor = [ getattr(stressResult, 'STEP_{}'.format(step))[i,j] for j in range(startRange,ni*6, 6)]
            print(valor)
            cdsVector = [ rg.Vector3d.Multiply(e, ivalor*scale) for ivalor in valor ]
            #----------------------------------------------------------------#
            cdsView, cdsPoint = alpacaView.cdsMesh( item, cdsVector, colorPos, colorNeg)
            CDSView.append(cdsView)
            CDSPoint.append(cdsPoint)
            CDSValor.append(valor)
            
        Hdf5.CloseFile(fileId)
        
        self.Pos = CDSPoint
        self.Valor = CDSValor
        self.ForcesDiagram = CDSView
        

        return self.ForcesDiagram
        
    def DrawViewportWires(self,arg):
        # node Tag view
        for iPos, ivalor, iMesh in zip(self.Pos, self.Valor, self.ForcesDiagram) :
            colorWirframe = System.Drawing.Color.Black
            arg.Display.DrawMeshWires(iMesh, colorWirframe)
            if self.viewValor is True:
                for jpos, jvalor in zip(iPos, ivalor):
                    t = 25
                    txt = str( round( jvalor, 2))
                    arg.Display.Draw2dText( txt, System.Drawing.Color.Black, jpos, True, t)
# ---------- end bfd ----------
gradientlibrary = GradientLibrary(gradIndex=Slider(4, range=1..12))  # -> reverse(colors); inputs gradIndex: Int32
#   port colors: A series of colors to be plugged into the "Ladybug_Legend Parameters" component.
# ---------- gradientlibrary: Python ----------
"""
Preset of gradient colors perfect for Data Visualisation
    Inputs:
        gradIndex: An index refering to one of the following possible gradients:
            0 - Orignal Ladybug
            1 - Nuanced Ladybug
            2 - Multi-colored Ladybug
            3 - Ecotect
            4 - Thermal Comfort Percentage
            5 - Thermal Comfort Colors
            6 - Shade Benefit/Harm
            7 - Shade Harm
            8 - Shade Benefit
            9 - CFD Colors 1
            10 - Radiation Benefit
            11 - Gsa10 Colour
            12 - Gsa9 Colour
    Returns:
        customColors: A series of colors.
"""

ghenv.Component.Name = "Gradient Library"
ghenv.Component.NickName = 'GradientLibrary'
#ghenv.Component.Message = 'GradientLibrary\nWIP'

import scriptcontext as sc
import Grasshopper.Kernel as gh
import System

gradientLibrary = {
        0: [System.Drawing.Color.FromArgb(75, 107, 169), System.Drawing.Color.FromArgb(115, 147, 202), System.Drawing.Color.FromArgb(170, 200, 247), System.Drawing.Color.FromArgb(193, 213, 208), System.Drawing.Color.FromArgb(245, 239, 103), System.Drawing.Color.FromArgb(252, 230, 74), System.Drawing.Color.FromArgb(239, 156, 21), System.Drawing.Color.FromArgb(234, 123, 0), System.Drawing.Color.FromArgb(234, 74, 0), System.Drawing.Color.FromArgb(234, 38, 0)],
        1: [System.Drawing.Color.FromArgb(49,54,149), System.Drawing.Color.FromArgb(69,117,180), System.Drawing.Color.FromArgb(116,173,209), System.Drawing.Color.FromArgb(171,217,233), System.Drawing.Color.FromArgb(224,243,248), System.Drawing.Color.FromArgb(255,255,191), System.Drawing.Color.FromArgb(254,224,144), System.Drawing.Color.FromArgb(253,174,97), System.Drawing.Color.FromArgb(244,109,67), System.Drawing.Color.FromArgb(215,48,39), System.Drawing.Color.FromArgb(165,0,38)],
        2: [System.Drawing.Color.FromArgb(4,25,145), System.Drawing.Color.FromArgb(7,48,224), System.Drawing.Color.FromArgb(7,88,255), System.Drawing.Color.FromArgb(1,232,255), System.Drawing.Color.FromArgb(97,246,156), System.Drawing.Color.FromArgb(166,249,86), System.Drawing.Color.FromArgb(254,244,1), System.Drawing.Color.FromArgb(255,121,0), System.Drawing.Color.FromArgb(239,39,0), System.Drawing.Color.FromArgb(138,17,0)],
        3: [System.Drawing.Color.FromArgb(0,0,255), System.Drawing.Color.FromArgb(53,0,202), System.Drawing.Color.FromArgb(107,0,148), System.Drawing.Color.FromArgb(160,0,95), System.Drawing.Color.FromArgb(214,0,41), System.Drawing.Color.FromArgb(255,12,0), System.Drawing.Color.FromArgb(255,66,0), System.Drawing.Color.FromArgb(255,119,0), System.Drawing.Color.FromArgb(255,173,0), System.Drawing.Color.FromArgb(255,226,0), System.Drawing.Color.FromArgb(255,255,0)],
        4: [System.Drawing.Color.FromArgb(0,0,0), System.Drawing.Color.FromArgb(110,0,153), System.Drawing.Color.FromArgb(255,0,0), System.Drawing.Color.FromArgb(255,255,102), System.Drawing.Color.FromArgb(255,255,255)],
        5: [System.Drawing.Color.FromArgb(0,136,255), System.Drawing.Color.FromArgb(200,225,255), System.Drawing.Color.FromArgb(255,255,255), System.Drawing.Color.FromArgb(255,230,230), System.Drawing.Color.FromArgb(255,0,0)],
        6: [System.Drawing.Color.FromArgb(5,48,97), System.Drawing.Color.FromArgb(33,102,172), System.Drawing.Color.FromArgb(67,147,195), System.Drawing.Color.FromArgb(146,197,222), System.Drawing.Color.FromArgb(209,229,240), System.Drawing.Color.FromArgb(255,255,255), System.Drawing.Color.FromArgb(253,219,199), System.Drawing.Color.FromArgb(244,165,130), System.Drawing.Color.FromArgb(214,96,77), System.Drawing.Color.FromArgb(178,24,43), System.Drawing.Color.FromArgb(103,0,31)],
        7: [System.Drawing.Color.FromArgb(255,255,255), System.Drawing.Color.FromArgb(253,219,199), System.Drawing.Color.FromArgb(244,165,130), System.Drawing.Color.FromArgb(214,96,77), System.Drawing.Color.FromArgb(178,24,43), System.Drawing.Color.FromArgb(103,0,31)],
        8: [System.Drawing.Color.FromArgb(255,255,255), System.Drawing.Color.FromArgb(209,229,240), System.Drawing.Color.FromArgb(146,197,222), System.Drawing.Color.FromArgb(67,147,195), System.Drawing.Color.FromArgb(33,102,172), System.Drawing.Color.FromArgb(5,48,97)],
        9: [System.Drawing.Color.FromArgb(0,16,120), System.Drawing.Color.FromArgb(38,70,160), System.Drawing.Color.FromArgb(5,180,222), System.Drawing.Color.FromArgb(16,180,109), System.Drawing.Color.FromArgb(59,183,35), System.Drawing.Color.FromArgb(143,209,19), System.Drawing.Color.FromArgb(228,215,29), System.Drawing.Color.FromArgb(246,147,17), System.Drawing.Color.FromArgb(243,74,0), System.Drawing.Color.FromArgb(255,0,0)],
        10: [System.Drawing.Color.FromArgb(0,191,48), System.Drawing.Color.FromArgb(255,238,184), System.Drawing.Color.FromArgb(255,0,0)],
        11: [System.Drawing.Color.FromArgb(204,0,71), System.Drawing.Color.FromArgb(255,182,71), System.Drawing.Color.FromArgb(206,255,115), System.Drawing.Color.FromArgb(26,180, 214),System.Drawing.Color.FromArgb(0,0,207)],
        12: [System.Drawing.Color.FromArgb(255, 51, 51), System.Drawing.Color.FromArgb(255, 170, 51), System.Drawing.Color.FromArgb(255, 255, 51), System.Drawing.Color.FromArgb(170, 255, 125), System.Drawing.Color.FromArgb(51, 255, 231), System.Drawing.Color.FromArgb(51, 170, 255), System.Drawing.Color.FromArgb(51,51, 255)]}
colors = gradientLibrary[gradIndex]
# ---------- end gradientlibrary ----------
vm = ViewModelAlpaca4d(AlpacaModel=am.AlpacaModel, type=Toggle(True))  # inputs type: Boolean, nodeTag: Boolean, eleTag: Boolean, localAxis: Boolean, support: Boolean, load: Boolean
# ---------- vm: Python ----------
"""View structural Model
    Inputs:
        AlpacaModel: Output of Assemble Model.
        type: Style of visualize Model 
Default: Visualize the stick Model
True: Visualize the extrude Model
        nodeTag: 
True: Visualize tag nodes
        eleTag: 
True: Visualize tag elements 
        LocalAxes:
True: Visualize local Axis of elements 
        Support: 
True: Visualize support type
        Load: 
True: Visualize load
"""


from ghpythonlib.componentbase import executingcomponent as component
import Grasshopper, GhPython
import System
import ghpythonlib.components as ghcomp

import Rhino as rc
import rhinoscriptsyntax as rs
import sys
import Rhino.Geometry as rg
import Grasshopper as gh
import copy

ghenv.Component.Name = "View Model (Alpaca4d)"
ghenv.Component.NickName = 'VM'
ghenv.Component.Message = "View Model (Alpaca4d)"

ghcompfolder = gh.Folders.DefaultAssemblyFolder
if ghcompfolder not in sys.path:
    sys.path.append(ghcompfolder)
try:
    from Alpaca4d import alpaca4dView as alpacaView
except:
    msg = "Cannot import Alpaca4d. Is the Alpaca4d folder available in " + ghcompfolder + "?"
    ghenv.Component.AddRuntimeMessage(gh.Kernel.GH_RuntimeMessageLevel.Error, msg)

checkData = True

class MyComponent(component):
    
    def RunScript(self, AlpacaModel, type, nodeTag, eleTag, localAxis, support, load):
        
        if not AlpacaModel:
            checkData = False
            msg = "Input parameter AlpacaModel failed to collect data"
            ghenv.Component.AddRuntimeMessage(gh.Kernel.GH_RuntimeMessageLevel.Warning, msg)
        else:
            self.type = type
            
            ## add alpaca install directory to system path
            
            self.ModelBeam = alpacaView.ViewBeam( AlpacaModel, type)
            self.ModelShell = alpacaView.ViewShell( AlpacaModel, type )
            self.ModelBrick = alpacaView.ViewBrick( AlpacaModel)
            #NODE TAG VIEW
            if nodeTag is True:
                self.Nodes = [ [inode.nodeTag, inode.Pos] for inode in AlpacaModel.nodes]
            else:
                self.Nodes = []
            #ELE TAG VIEW
            if eleTag is True:
                TagBeam = [ [item.eleTag, item.getPerpFrame().Origin] for item in AlpacaModel.beams]
                TagShell = [ [item.eleTag, rg.AreaMassProperties.Compute( item.Mesh, False, True, False, False ).Centroid] for item in AlpacaModel.shells]
                TagBrick = [ [item.eleTag, rg.AreaMassProperties.Compute( item.Mesh, False, True, False, False ).Centroid] for item in AlpacaModel.bricks]
                self.TagEle = TagBeam + TagShell + TagBrick
            else:
                self.TagEle = []
            #LOCAL AXIS
            if localAxis is True:
                self.localAxis = [ item.getPerpFrame() for item in AlpacaModel.beams]
            else:
                self.localAxis = []
            #SUPPORT
            if support is True:
                scale = 0.5
                self.solidSupport = [ alpacaView.Support( iSupport, scale ) for iSupport in AlpacaModel.supports ]
            else:
                self.solidSupport = []
            # LOAD
            if load is True:
                self.viewLoad =[[item.Pos, item.Force, item.Moment] for item in AlpacaModel.loads]
            else:
                self.viewLoad = []
            self.forceBounds = ghcomp.Bounds([ item[1] for item in self.viewLoad])
            self.momentBounds = ghcomp.Bounds([ item[2] for item in self.viewLoad])

    def DrawViewportWires(self,arg):
        # Beam
        for iBeam in self.ModelBeam:
            color = iBeam[1]
            colorMaterial = rc.Display.DisplayMaterial(color, 0.3)
            if self.type is True:
                colorWirframe = System.Drawing.Color.Gray
                #System.Drawing.Color.LightGray
                arg.Display.DrawBrepShaded(iBeam[0], colorMaterial)
                arg.Display.DrawBrepWires(iBeam[0], colorWirframe)
            else :
                thickness =2
                arg.Display.DrawCurve(iBeam[0], color, thickness)
        # Mesh
        for iShell in self.ModelShell:
            color = iShell[1]
            #color = System.Drawing.Color.Blue
            colorMaterial = rc.Display.DisplayMaterial(color,color,color,color,1,0.30)
            colorMaterial.IsTwoSided = False
            arg.Display.DrawMeshShaded(iShell[0], colorMaterial)
            colorWirframe = System.Drawing.Color.Black
            arg.Display.DrawMeshWires(iShell[0], colorWirframe)
        #Brick 
        for iBrick in self.ModelBrick:
            color = iBrick[1]
            #color = System.Drawing.Color.Blue
            colorMaterial = rc.Display.DisplayMaterial(color,color,color,color,1,0.30)
            colorMaterial.IsTwoSided = False
            arg.Display.DrawMeshShaded(iBrick[0], colorMaterial)
            colorWirframe = System.Drawing.Color.Black
            arg.Display.DrawMeshWires(iBrick[0], colorWirframe)
            
        # node Tag view
        for inode in self.Nodes:
            arg.Display.Draw2dText( str(inode[0]), System.Drawing.Color.DarkSlateBlue, inode[1], True, 50)
        # ele Tag view
        for iEle in self.TagEle:
            arg.Display.Draw2dText( str(iEle[0]), System.Drawing.Color.BlanchedAlmond, iEle[1], True, 50)
        # local Axis
        for iLocalAxis in self.localAxis:
            arg.Display.DrawArrow( rg.Line(iLocalAxis.Origin, iLocalAxis.XAxis), System.Drawing.Color.Red)
            arg.Display.DrawArrow( rg.Line(iLocalAxis.Origin, iLocalAxis.YAxis), System.Drawing.Color.Green)
            arg.Display.DrawArrow( rg.Line(iLocalAxis.Origin, iLocalAxis.ZAxis), System.Drawing.Color.Blue)
            
        color = System.Drawing.Color.Azure
        colorWirframe = System.Drawing.Color.Black
        colorMaterial = rc.Display.DisplayMaterial(color, 0.0)
        for iSupport in self.solidSupport :
            arg.Display.DrawBrepShaded( iSupport, colorMaterial)
            arg.Display.DrawBrepWires( iSupport, colorWirframe)
            
        for iLoad in self.viewLoad:
            arg.Display.DrawArrow( rg.Line(iLoad[0], iLoad[1]/self.forceBounds[1]) ,  System.Drawing.Color.DarkRed)
            arg.Display.DrawArrow( rg.Line(iLoad[0], iLoad[2]/self.momentBounds[1]) ,  System.Drawing.Color.DarkBlue)
# ---------- end vm ----------
toggle_7 = BooleanToggle(False)
num = Number("0.025e-1")
dm = DeformedModelAlpaca4d(
    AlpacaSolvedModel=ra.AlpacaSolvedModel,
    extrudeModel=Toggle(True),
    typeColor=Slider(2, range=0..10),
    listColor=gradientlibrary)  # -> DefModel, bounds; inputs step: Int32, extrudeModel: Boolean, typeColor: Int32, listColor: list of Color
# ---------- dm: Python ----------
"""View Deformed model
    Args:
        AlpacaSolvedModel: Output of Analyses solver
        step:
        scale: Multiplication factor for displacement
        extrudeModel:  
True : view extruded model
else : view stick model
        typeColor:  View relative color of the traslation
<=0 : view traslation X 
1 : view traslation Y
2 : view traslation Z
>= 3 : view resulting displacement.
        listColor : one list of color 

    Output:
       DefModel: view deformed model
       bounds: max end min of displacement of the structure 
"""

ghenv.Component.Name = "Deformed Model (Alpaca4d)"
ghenv.Component.NickName = 'DM'
ghenv.Component.Message = "Deformed Model (Alpaca4d)"

from ghpythonlib.componentbase import executingcomponent as component
import System
import rhinoscriptsyntax as rs

import sys
import os
import clr
import clrtype
import Rhino.Geometry as rg
import Rhino as rc
import math as mt
import Grasshopper as gh
import ghpythonlib.treehelpers as th
from ghpythonlib.components import ConstructDomain

ghcompfolder = gh.Folders.DefaultAssemblyFolder
if ghcompfolder not in sys.path:
    sys.path.append(ghcompfolder)
try:
    from Alpaca4d import alpaca4dView as alpacaView
except:
    msg = "Cannot import Alpaca4d. Is the Alpaca4d folder available in " + ghcompfolder + "?"
    ghenv.Component.AddRuntimeMessage(gh.Kernel.GH_RuntimeMessageLevel.Error, msg)
    
FolderPath = rs.DocumentPath()
os.chdir(FolderPath)

ghcompfolder = gh.Folders.DefaultAssemblyFolder
my_module_name = "Alpaca_StepReader" # replace this with something unique that doesn't collide with a real module!
my_module = sys.modules.setdefault(my_module_name, type(sys)(my_module_name))

hdfFilePath = os.path.join(ghcompfolder, "Alpaca4d\HDF5CSharp.dll")
clr.AddReferenceToFileAndPath(hdfFilePath)


from HDF5CSharp import Hdf5

class MyComponent(component):
    
    def RunScript(self, AlpacaSolvedModel, step = None, scale = None , extrudeModel = None, typeColor = None, listColor = [] ):
        import sys
        
        self.extrudeModel = extrudeModel
        
        self.defModel1 = []
        self.defModel2 = []
        self.defModel3 = []
        
        self.beamColor = []
        

        if step == None:
            step = 0
        if scale == None:
            scale = 1
        if extrudeModel == None:
            extrudeModel = False
        if typeColor == None:
            typeColor = 3
        
        if not listColor: listColor = [ System.Drawing.Color.DarkViolet, 
                                        System.Drawing.Color.BlueViolet, 
                                        System.Drawing.Color.RoyalBlue, 
                                        System.Drawing.Color.CornflowerBlue,
                                        System.Drawing.Color.LightSkyBlue, 
                                        System.Drawing.Color.LightBlue,
                                        System.Drawing.Color.CadetBlue,
                                        System.Drawing.Color.LightGreen,
                                        System.Drawing.Color.GreenYellow,
                                        System.Drawing.Color.Yellow,
                                        System.Drawing.Color.Orange,
                                        System.Drawing.Color.Red,
                                        System.Drawing.Color.DarkRed]
        
        
        ghcompfolder = gh.Folders.DefaultAssemblyFolder
        if ghcompfolder not in sys.path:
            sys.path.append(ghcompfolder)
    
        try:
            Steps = my_module.Steps
        except AttributeError:
            type_2d = type(System.Array.CreateInstance(float, 1, 1))
                
            class Steps(object):
                __metaclass__ = clrtype.ClrClass
                _clrfields = {"STEP_{}".format(i): type_2d for i in range(1000)} # it will work for model with less than 1000 steps
                
            my_module.Steps = Steps
            
        checkData = True
        
        if not AlpacaSolvedModel:
            checkData = False
            msg = "Input parameter AlpacaSolvedModel failed to collect data"
            ghenv.Component.AddRuntimeMessage(gh.Kernel.GH_RuntimeMessageLevel.Warning, msg)
        else:
            try:
                fileId = Hdf5.OpenFile(AlpacaSolvedModel.recorderName, True)
                numberOfPoints = len(AlpacaSolvedModel.uniquePoints) #
                        
                        
                displacementResult = Hdf5.ReadObject[Steps](fileId, "/MODEL_STAGE[1]/RESULTS/ON_NODES/DISPLACEMENT/DATA")
                displacement = []
                rotation = []
                dispNodeList = []
                for i in range(numberOfPoints):
                    tag = i + 1
                    vx = getattr(displacementResult, 'STEP_{}'.format(step))[i,0]
                    vy = getattr(displacementResult, 'STEP_{}'.format(step))[i,1]
                    vz = getattr(displacementResult, 'STEP_{}'.format(step))[i,2]
                    trasl = rg.Vector3d(vx,vy,vz)
                    displacement.append(trasl)
                    dispNodeList.append( [tag, trasl] )
                    
                Hdf5.CloseFile(fileId)
                print("I have closed the file")
            
                dispNodeDict = dict( dispNodeList )
                #---------------------------------------------------#
                defEleVector1 = alpacaView.BeamVectorDef(AlpacaSolvedModel,dispNodeDict) #beam
                defEleVector2 = alpacaView.ShellVectorDef(AlpacaSolvedModel,dispNodeDict) #shell
                defEleVector3 = alpacaView.BrickVectorDef(AlpacaSolvedModel,dispNodeDict) #shell
                bound = alpacaView.boundsDef(displacement, typeColor)
                if self.extrudeModel == None or self.extrudeModel == False:
                    print(self.extrudeModel== False)
                    #BEAM
                    defModel1 = alpacaView.BeamDef(AlpacaSolvedModel, dispNodeDict,scale)
                    self.defModel1, self.beamColor = alpacaView.ColorBeamDef( defModel1, defEleVector1, bound, listColor, typeColor)
                    #SHELL
                    defModel2 = alpacaView.ShellDef(AlpacaSolvedModel,dispNodeDict,scale)
                    #BRICK
                    defModel3 = alpacaView.BrickDef(AlpacaSolvedModel,dispNodeDict,scale)
                else:
                    #BEAM
                    defModel1 = alpacaView.BeamDefExtrude(AlpacaSolvedModel, dispNodeDict,scale)
                    self.defModel1 = alpacaView.ColorBeamDefExtrude( defModel1, defEleVector1, bound, listColor, typeColor)
                    #SHELL
                    defModel2 = alpacaView.ShellDefExtrude(AlpacaSolvedModel,dispNodeDict,scale)
                    #BRICK
                    defModel3 = alpacaView.BrickDef(AlpacaSolvedModel,dispNodeDict,scale)
                    
                #SHELL COLOR
                self.defModel2 = alpacaView.ColorShellDef( defModel2, defEleVector2 , bound, listColor, typeColor, extrudeModel )
                #BRICK COLOR
                self.defModel3 = alpacaView.ColorBrickDef( defModel3, defEleVector3 , bound, listColor, typeColor)
                DefModel = th.list_to_tree(self.defModel1 + defModel2 + defModel3)
                bounds = ConstructDomain(bound[0], bound[1])
                return (DefModel, bounds)
            except:
                Hdf5.CloseFile(fileId)
                print("I have closed the file due to exception")
            # return outputs if you have them; here I try it for you:
        
        
    def DrawViewportWires(self,arg):
        for iMesh in self.defModel2 :
            colorWirframe = System.Drawing.Color.Black
            arg.Display.DrawMeshWires(iMesh, colorWirframe)
            
        for iMesh in self.defModel3 :
            colorWirframe = System.Drawing.Color.Black
            arg.Display.DrawMeshWires(iMesh, colorWirframe)
        if self.extrudeModel is None or self.extrudeModel is False:
            thickness =2
            for iBeam, iColor in zip(self.defModel1, self.beamColor) :
                for jBeam, jColor in zip(iBeam, iColor):
                    arg.Display.DrawCurve(jBeam, jColor, thickness)
        else:
            for iBeam in self.defModel1 :
                colorWirframe = System.Drawing.Color.Black
                arg.Display.DrawMeshWires(iBeam, colorWirframe)
# ---------- end dm ----------
