# Grasshopper definition Domenico_developmentScript.gh (Grasshopper 1.0.7)
# plug-ins: Kangaroo2 Components

number_slider = Slider(0, range=0..10)
number_slider_2 = Slider(2, range=0..10)
number_slider_3 = Slider(3, range=0..10)

number_slider_4 = Slider(0.15, range=0..1)
number_slider_5 = Slider(7, range=0..10)
number_slider_6 = Slider(1, range=0..10)
series = Series(Start=0, Step=Slider(4, range=0..10), Count=Slider(5, range=0..100))
pt = ConstructPoint(XCoordinate=number_slider, YCoordinate=number_slider, ZCoordinate=number_slider)
pt_2 = ConstructPoint(XCoordinate=0, YCoordinate=0, ZCoordinate=0)
X = UnitX(Factor=Slider(10, range=0..10))
X_2 = UnitX(Factor=number_slider_5)
addition = Addition(A=number_slider_5, B=Slider(1, range=0..10))
neg = Negative(Value=number_slider_4)
neg_2 = Negative(Value=number_slider_4)
move = Move(Geometry=pt_2, Motion=X_2)  # -> Geometry, Transform
move_2 = Move(Geometry=pt, Motion=X)  # -> Geometry, Transform
series_2 = Series(Start=0, Step=Slider(6, range=0..10), Count=number_slider_2)
concat = Concatenate(FragmentA=neg, FragmentC=" to ", FragmentB=number_slider_4)
concat_2 = Concatenate(FragmentA=neg_2, FragmentC=" to ", FragmentB=number_slider_4)
subtraction = Subtraction(A=number_slider_2, B=1)
ln = Line(StartPoint=pt, EndPoint=move_2.Geometry)
Y = UnitY(Factor=series_2)
cat = Catenary(PointA=pt_2, PointB=move.Geometry, Length=addition, Gravity=Vector(0, 0, -1))
xy = XYPlane(Origin=Point(0, 0, 0))
rectangle = Rectangle(Plane=PlaneXY(0, 0, 0), XSize=concat_2, YSize=concat, Radius=0)  # -> Rectangle, Length
cone = Cone(Base=[pt_2, move.Geometry], Radius="0.2", Length="0.35")  # -> Cone, Tip
number_slider_7 = Slider(1, range=0..10)
move_3 = Move(Geometry=ln, Motion=Y)  # -> Geometry, Transform
mirror = Mirror(Geometry=cat, Plane=xy)  # -> Geometry, Transform
Z = UnitZ(Factor=Slider(0.24, range=0..1))  # -> expr("-x", UnitVector)
move_4 = Move(Geometry=cone.Cone, Motion=Z)  # -> Geometry, Transform
addition_2 = Addition(A=number_slider_3, B="1")
mesh_uv = MeshSurface(Surface=rectangle.Rectangle, UCount="10", VCount="10", Overhang=True, Equalize=False)
divide = DivideCurve(Curve=move_3.Geometry, Count=number_slider_3, Kinks=False)  # -> Points, Tangents, Parameters
divide_2 = DivideCurve(Curve=mirror.Geometry, Count=Slider(70, range=0..100), Kinks=False)  # -> Points, Tangents, Parameters
pframe = PerpFrame(Curve=mirror.Geometry, Parameter=divide_2.Parameters)
shatter = Shatter(Curve=graft(move_3.Geometry), Parameters=divide.Parameters)
flip = FlipMatrix(Data=divide.Points)
deplane = DeconstructPlane(Plane=pframe)  # -> Origin, XAxis, YAxis, ZAxis
pline = PolyLine(Vertices=flip, Closed=False)
move_5 = Move(Geometry=mesh_uv, Motion=divide_2.Points)  # -> Geometry, Transform
Z_2 = UnitZ(Factor=1)
Y_2 = UnitY(Factor=1)
Z_3 = UnitZ(Factor=series)  # -> graft(UnitVector)
data = Data(flatten([shatter, pline]))
angle = Angle(VectorA=deplane.ZAxis, VectorB=Z_2)  # -> Angle, Reflex
rot3d = Rotate3D(Geometry=graft(move_5.Geometry), Angle=graft(angle.Angle), Center=graft(divide_2.Points), Axis=Y_2)  # -> Geometry, Transform

# ----
# nDMaterial
# ElasticIsotropic
python = GhPythonScript(E="210", v="0.3", rho="7850")  # -> out, nDMaterial
# ---------- python: Python ----------
"""
Create a support
-
    Args:
        name:
        E:
        G:
        v:
        rho:
    Returns:
        nDMaterial:
"""


import sys
import Rhino.Geometry as rg
import Grasshopper as gh
import copy


## add alpaca install directory to system path

ghcompfolder = gh.Folders.DefaultAssemblyFolder
if ghcompfolder not in sys.path:
    sys.path.append(ghcompfolder)

try:
    from Alpaca4d import alpaca4d as alpaca
except:
    msg = "Cannot import Alpaca4d. Is the Alpaca4d folder available in " + ghcompfolder + "?"
    ghenv.Component.AddRuntimeMessage(gh.Kernel.GH_RuntimeMessageLevel.Error, msg)


checkData = True

if not E:
    checkData = False
    msg = "Input parameter E failed to collect data"
    ghenv.Component.AddRuntimeMessage(gh.Kernel.GH_RuntimeMessageLevel.Warning, msg)

if not G and not v:
    checkData = False
    msg = "Input parameter G or v failed to collect data"
    ghenv.Component.AddRuntimeMessage(gh.Kernel.GH_RuntimeMessageLevel.Warning, msg)

if not rho:
    checkData = False
    msg = "Input parameter rho failed to collect data"
    ghenv.Component.AddRuntimeMessage(gh.Kernel.GH_RuntimeMessageLevel.Warning, msg)

if checkData:
    nDMaterial = alpaca.ElasticIsotropic(name, E, G, rho, v)
# ---------- end python ----------

move_6 = Move(Geometry=data, Motion=Z_3)  # -> Geometry, Transform
explode = Explode(Curve=move_6.Geometry, Recursive=True)  # -> Segments, Vertices
end = EndPoints(Curve=ln)  # -> Start, End
mesh = Mesh(flatten(rot3d.Geometry))
trim = TrimTree(Tree=explode.Vertices, Depth=1)
item = ListItem(List=flatten(rot3d.Geometry), Index=0, Wrap=True)  # -> Item1, Item
demesh = DeconstructMesh(Mesh=flatten(rot3d.Geometry))  # -> flatten(Vertices), Faces, Colours, Normals
duppt = RemoveDuplicatePts(Points=trim, Tolerance=0.01)
mstb = MeshSeriesToBrickAlpaca4d(MeshSeries=mesh)  # -> simplify(flatten(Brick)); inputs MeshSeries: list of Mesh
# ---------- mstb: Python ----------
"""Generate a Brick element from a list of mesh .
    the faces of the mesh '0' will be connected with the faces of the meshes '1' generating a brick element ( cube ).
    Attention : Each mesh in the list must have the same number of faces.
    Inputs:
        MeshSeries: quadMesh list with the same number of subdivisions .
    Output:
        Brick: Brick element --> Mesh with 6 faces and 8 nodes.
       """
import Rhino.Geometry as rg
import Grasshopper as gh

def MeshToShell(Mesh):
    
    Mesh.Unweld(0, True)
    mesh = Mesh.ExplodeAtUnweldedEdges()
    #print( len(mesh) )
    newMesh = []
    elementType = []
    for explodedMesh in mesh:
        newMesh.append(explodedMesh)
    return newMesh 

def brick( MeshList ):
    meshExpl = []
    Vertix = []
    elementType = []
    solid = []
    a = rg.Mesh.DuplicateMesh( MeshList[0] ) #.Unweld(0, True)
    a.Unweld(0, True)
    b = a.ExplodeAtUnweldedEdges()
    if len( b ) > 0 :
        for Mesh in MeshList:
            shellWrapper = MeshToShell(Mesh)
            meshExpl.append( shellWrapper )
        for index1 in range(0, len(MeshList)-1):
            for index2 in range(0, len(meshExpl[0])):
                if meshExpl[ index1 ][ index2 ].Vertices.Count == 4:
                    
                    elementType.append("stdBrick")
                    vertix1 = meshExpl[ index1 ][ index2 ].Vertices[0]
                    vertix2 = meshExpl[ index1 ][ index2 ].Vertices[1]
                    vertix3 = meshExpl[ index1 ][ index2 ].Vertices[2]
                    vertix4 = meshExpl[ index1 ][ index2 ].Vertices[3]
                    vertix5 = meshExpl[index1 + 1 ][ index2].Vertices[0]
                    vertix6 = meshExpl[index1 + 1 ][ index2].Vertices[1]
                    vertix7 = meshExpl[index1 + 1 ][ index2].Vertices[2]
                    vertix8 = meshExpl[index1 + 1 ][ index2].Vertices[3]
                    
                    vertix = [ vertix1, vertix2, vertix3, vertix4,
                    vertix5, vertix6, vertix7, vertix8 ]
                    
                    ele = rg.Mesh()
                    
                    ele.Vertices.Add( vertix1 ) # 0 
                    ele.Vertices.Add( vertix2 ) # 1
                    ele.Vertices.Add( vertix3 ) # 2
                    ele.Vertices.Add( vertix4 ) # 3
                    ele.Vertices.Add( vertix5 ) # 4
                    ele.Vertices.Add( vertix6 ) # 5
                    ele.Vertices.Add( vertix7 ) # 6
                    ele.Vertices.Add( vertix8 ) # 7
                    
                    ele.Faces.AddFace(0, 1, 2, 3) # 0
                    ele.Faces.AddFace(4, 5, 6, 7) # 1
                    ele.Faces.AddFace(0, 1, 5, 4) # 2
                    ele.Faces.AddFace(3, 2, 6, 7) # 3
                    ele.Faces.AddFace(1, 5, 6, 2) # 4
                    ele.Faces.AddFace(0, 4, 7, 3) # 5
                solid.append(ele)
                #ele.IsClosed()
                    
    else:
        for index1 in range(0, len(MeshList)-1):
            elementType.append("stdBrick")
            vertix1 = MeshList[ index1 ].Vertices[0]
            vertix2 = MeshList[ index1 ].Vertices[1]
            vertix3 = MeshList[ index1 ].Vertices[2]
            vertix4 = MeshList[ index1 ].Vertices[3]
            vertix5 = MeshList[index1 + 1 ].Vertices[0]
            vertix6 = MeshList[index1 + 1 ].Vertices[1]
            vertix7 = MeshList[index1 + 1 ].Vertices[2]
            vertix8 = MeshList[index1 + 1 ].Vertices[3]
            
            vertix = [ vertix1, vertix2, vertix3, vertix4,
            vertix5, vertix6, vertix7, vertix8 ]
            
            ele = rg.Mesh()
            
            ele.Vertices.Add( vertix1 ) # 0 
            ele.Vertices.Add( vertix2 ) # 1
            ele.Vertices.Add( vertix3 ) # 2
            ele.Vertices.Add( vertix4 ) # 3
            ele.Vertices.Add( vertix5 ) # 4
            ele.Vertices.Add( vertix6 ) # 5
            ele.Vertices.Add( vertix7 ) # 6
            ele.Vertices.Add( vertix8 ) # 7
            
            ele.Faces.AddFace(0, 1, 2, 3) # 0
            ele.Faces.AddFace(4, 5, 6, 7) # 1
            ele.Faces.AddFace(0, 1, 5, 4) # 2
            ele.Faces.AddFace(3, 2, 6, 7) # 3
            ele.Faces.AddFace(1, 5, 6, 2) # 4
            ele.Faces.AddFace(0, 4, 7, 3) # 5
            
            solid.append(ele)
            '''
            else :
                elementType.append(["FourNodeTetrahedron"]*3)
                
                if meshExpl[ index1 ][ index2 ].Vertices[0] == meshExpl[index1 + 1 ][ index2].Vertices[0] :
                    vertix1 = meshExpl[ index1 ][ index2 ].Vertices[0]
                    vertix2 = meshExpl[ index1 ][ index2 ].Vertices[1]
                    vertix3 = meshExpl[ index1 ][ index2 ].Vertices[2]
                    vertix4 = meshExpl[index1 + 1 ][ index2].Vertices[1]
                    vertix5 = meshExpl[index1 + 1 ][ index2].Vertices[2]
                    
                    vertixEle1 = [ vertix1, vertix2, vertix3, vertix4 ]
                    vertixEle2 = [ vertix1, vertix2, vertix3, vertix2 ]
                    
                    ele1 = rg.Mesh() # Tetrahedron 1
                    ele2 = rg.Mesh() # Tetrahedron 2
                    
                    ele1.Vertices.Add( vertix1 ) # 0 
                    ele1.Vertices.Add( vertix2 ) # 1
                    ele1.Vertices.Add( vertix3 ) # 2 
                    ele1.Vertices.Add( vertix4 ) # 3 
                    
                    ele1.VertexColors.Add(color)
                    ele1.VertexColors.Add(color)
                    ele1.VertexColors.Add(color)
                    ele1.VertexColors.Add(color)
                    
                    ele2.Vertices.Add( vertix1 ) # 0 
                    ele2.Vertices.Add( vertix2 ) # 1 
                    ele2.Vertices.Add( vertix3 ) # 2 
                    ele2.Vertices.Add( vertix2 ) # 3
    
                    ele2.VertexColors.Add(color)
                    ele2.VertexColors.Add(color)
                    ele2.VertexColors.Add(color)
                    ele2.VertexColors.Add(color)
                    
                    ele1.Faces.AddFace(0, 1, 4 ) # 0
                    ele1.Faces.AddFace(0, 1, 3 ) # 1
                    ele1.Faces.AddFace(0, 4, 3 ) # 2
                    ele1.Faces.AddFace(1, 3, 4 ) # 3
                    
                    ele2.Faces.AddFace(0, 1, 3 ) # 0
                    ele2.Faces.AddFace(0, 1, 2 ) # 1
                    ele2.Faces.AddFace(1, 2, 3 ) # 2
                    ele2.Faces.AddFace(0, 2, 3 ) # 3
                    
                    ele = [ ele1, ele2 ]
                    
                else :
                
                    vertix1 = meshExpl[ index1 ][ index2 ].Vertices[0]
                    vertix2 = meshExpl[ index1 ][ index2 ].Vertices[1]
                    vertix3 = meshExpl[ index1 ][ index2 ].Vertices[2]
                    vertix4 = meshExpl[index1 + 1 ][ index2].Vertices[0]
                    vertix5 = meshExpl[index1 + 1 ][ index2].Vertices[1]
                    vertix6 = meshExpl[index1 + 1 ][ index2].Vertices[2]
                    
                    vertixEle1 = [ vertix1, vertix2, vertix3, vertix6 ]
                    vertixEle2 = [ vertix4, vertix5, vertix6, vertix1 ]
                    vertixEle3 = [ vertix5, vertix6, vertix2, vertix1 ]
                    
                    vertix = [ vertixEle1, vertixEle2, vertixEle3 ]
                    
                    ele1 = rg.Mesh() # Tetrahedron 1
                    ele2 = rg.Mesh() # Tetrahedron 2
                    ele3 = rg.Mesh() # Tetrahedron 3
                    
                    ele1.Vertices.Add( vertix1 ) # 0 
                    ele1.Vertices.Add( vertix2 ) # 1
                    ele1.Vertices.Add( vertix3 ) # 2 
                    ele1.Vertices.Add( vertix6 ) # 3 
                    
                    ele1.VertexColors.Add(color)
                    ele1.VertexColors.Add(color)
                    ele1.VertexColors.Add(color)
                    ele1.VertexColors.Add(color)
                    
                    ele2.Vertices.Add( vertix4 ) # 0 
                    ele2.Vertices.Add( vertix5 ) # 1 
                    ele2.Vertices.Add( vertix6 ) # 2 
                    ele2.Vertices.Add( vertix1 ) # 3
    
                    ele2.VertexColors.Add(color)
                    ele2.VertexColors.Add(color)
                    ele2.VertexColors.Add(color)
                    ele2.VertexColors.Add(color)
                    
                    ele3.Vertices.Add( vertix5 ) # 0 
                    ele3.Vertices.Add( vertix6 ) # 1 
                    ele3.Vertices.Add( vertix2 ) # 2 
                    ele3.Vertices.Add( vertix1 ) # 3
                    
                    ele3.VertexColors.Add(color)
                    ele3.VertexColors.Add(color)
                    ele3.VertexColors.Add(color)
                    ele3.VertexColors.Add(color)
                    
                    ele1.Faces.AddFace(0, 1, 2 ) # 0
                    ele1.Faces.AddFace(0, 3, 1 ) # 1
                    ele1.Faces.AddFace(0, 3, 2 ) # 2
                    ele1.Faces.AddFace(1, 3, 2 ) # 3
                    
                    ele2.Faces.AddFace(0, 1, 2 ) # 0
                    ele2.Faces.AddFace(0, 3, 1 ) # 1
                    ele2.Faces.AddFace(0, 3, 2 ) # 2
                    ele2.Faces.AddFace(1, 3, 2 ) # 3
                    
                    ele3.Faces.AddFace(0, 1, 2 ) # 0
                    ele3.Faces.AddFace(0, 3, 1 ) # 1
                    ele3.Faces.AddFace(0, 3, 2 ) # 2
                    ele3.Faces.AddFace(1, 3, 2 ) # 3
                    
                    ele = [ ele1, ele2, ele3 ]
            
            solid.append(ele)
            Vertix.append( vertix )
            '''
    return solid

checkData = True

if not MeshSeries or len(MeshSeries) == 1 :  #is not None:
    checkData = False
    msg = "input 'MeshSeries' failed to collect data"
    ghenv.Component.AddRuntimeMessage( gh.Kernel.GH_RuntimeMessageLevel.Warning, msg )

if checkData != False:
    Brick= brick( MeshSeries )
# ---------- end mstb ----------
duppt_2 = RemoveDuplicatePts(Points=demesh.Vertices, Tolerance=0.01)
flip_2 = FlipMatrix(Data=duppt)
demesh_2 = DeconstructMesh(Mesh=flatten([item.Item1, item.Item]))  # -> flatten(Vertices), Faces, Colours, Normals
trim_2 = TrimTree(Tree=explode.Segments, Depth=1)

# ----
# Plate Fiber Section
python_2 = GhPythonScript(thickness="0.15", nDMaterial=python.nDMaterial)  # -> out, fiberSection
# ---------- python_2: Python ----------
"""
Create a support
-
    Args:
        secName:
        thickness:
        nDMaterial:
    Returns:
        fiberSection:
"""


import sys
import Rhino.Geometry as rg
import Grasshopper as gh
import copy


## add alpaca install directory to system path

ghcompfolder = gh.Folders.DefaultAssemblyFolder
if ghcompfolder not in sys.path:
    sys.path.append(ghcompfolder)

try:
    from Alpaca4d import alpaca4d as alpaca
except:
    msg = "Cannot import Alpaca4d. Is the Alpaca4d folder available in " + ghcompfolder + "?"
    ghenv.Component.AddRuntimeMessage(gh.Kernel.GH_RuntimeMessageLevel.Error, msg)


checkData = True

if not thickness:
    checkData = False
    msg = "Input parameter thickness failed to collect data"
    ghenv.Component.AddRuntimeMessage(gh.Kernel.GH_RuntimeMessageLevel.Warning, msg)

if not nDMaterial:
    checkData = False
    msg = "Input parameter nDMaterial failed to collect data"
    ghenv.Component.AddRuntimeMessage(gh.Kernel.GH_RuntimeMessageLevel.Warning, msg)

if checkData:
    fiberSection = alpaca.PlateFiberSection(secName, thickness, nDMaterial)
# ---------- end python_2 ----------

pdecon = Deconstruct(Point=duppt_2)  # -> XComponent, YComponent, ZComponent
sort_pt = SortPoints(Points=duppt)  # -> Points, Indices
pline_2 = PolyLine(Vertices=flip_2, Closed=False)
split = SplitTree(Data=simplify(trim_2), Masks=flatten("{0}"))  # -> Positive, Negative
bnd = Bounds(Numbers=pdecon.ZComponent)
explode_2 = Explode(Curve=pline_2, Recursive=True)  # -> Segments, Vertices
srfgrid = SurfaceFromPoints(Points=sort_pt.Points, UCount=addition_2, Interpolate=False)
dedomain = DeconstructDomain(Domain=bnd)  # -> Start, End
swatch = ColourSwatch(SwatchColor=RGB(240, 0, 0))
duppt_3 = RemoveDuplicatePts(Points=demesh_2.Vertices, Tolerance=0.01)

# ----
# Support
toggle = BooleanToggle(True)
toggle_2 = BooleanToggle(True)
support = SupportAlpaca4d(Pos=duppt_3, Tx=toggle, Ty=toggle, Tz=toggle, Rx=toggle, Ry=toggle_2, Rz=toggle_2)  # -> Support; inputs Pos: Point3d, Tx: Boolean, Ty: Boolean, Tz: Boolean, Rx: Boolean, Ry: Boolean, Rz: Boolean
# ---------- support: Python ----------
"""
Create a support
-
    Args:
        Pos:
        Tx:
        Ty:
        Tz:
        Rx:
        Ry:
    Returns:
        Support:
"""

ghenv.Component.Name = "Support (Alpaca4d)"
ghenv.Component.NickName = 'Support'
ghenv.Component.Message = "Support (Alpaca4d)"


import sys
import Rhino.Geometry as rg
import Grasshopper as gh


## add alpaca install directory to system path

ghcompfolder = gh.Folders.DefaultAssemblyFolder
if ghcompfolder not in sys.path:
    sys.path.append(ghcompfolder)

try:
    from Alpaca4d import alpaca4d as alpaca
except:
    msg = "Cannot import Alpaca4d. Is the Alpaca4d folder available in " + ghcompfolder + "?"
    ghenv.Component.AddRuntimeMessage(gh.Kernel.GH_RuntimeMessageLevel.Error, msg)

checkData = True


if not Pos:
    checkData = False
    msg = "Input parameter Pos failed to collect data"
    ghenv.Component.AddRuntimeMessage(gh.Kernel.GH_RuntimeMessageLevel.Warning, msg)

if checkData:
    Support = alpaca.Support(Pos, Tx, Ty, Tz, Rx, Ry, Rz)
# ---------- end support ----------

flip_3 = FlipMatrix(Data=explode_2.Segments)
larger = LargerThan(FirstNumber=pdecon.ZComponent, SecondNumber=dedomain.End)  # -> LargerThan, OrEqualTo

# ----
# Constant Time Series
# Linear Time Series
python_3 = GhPythonScript()  # -> timeSeries, Graph
# ---------- python_3: Python ----------
"""
Create a PointLoad
-
    Args:
        tStart:
        tEnd:
        period:
        factor:
        shift:
    Returns:
        timeSeries:
        Graph:
"""

import sys
import Rhino.Geometry as rg
import Grasshopper as gh
import copy
import math


## add alpaca install directory to system path

ghcompfolder = gh.Folders.DefaultAssemblyFolder
if ghcompfolder not in sys.path:
    sys.path.append(ghcompfolder)

try:
    from Alpaca4d import alpaca4d as alpaca
except:
    msg = "Cannot import Alpaca4d. Is the Alpaca4d folder available in " + ghcompfolder + "?"
    ghenv.Component.AddRuntimeMessage(gh.Kernel.GH_RuntimeMessageLevel.Error, msg)

def ConstantSeries(x):
    return x



checkData = True

if not constantFactor:
    constantFactor = 1


if checkData:
    timeSeries = alpaca.TimeSeriesConstant(constantFactor)
    
    Graph = []
    
    for x in range(10):
        Graph.append(ConstantSeries(constantFactor))
# ---------- end python_3 ----------
python_4 = GhPythonScript()  # -> timeSeries, Graph
# ---------- python_4: Python ----------
"""
Create a PointLoad
-
    Args:
        tStart:
        tEnd:
        period:
        factor:
        shift:
    Returns:
        timeSeries:
        Graph:
"""

import sys
import Rhino.Geometry as rg
import Grasshopper as gh
import copy
import math


## add alpaca install directory to system path

ghcompfolder = gh.Folders.DefaultAssemblyFolder
if ghcompfolder not in sys.path:
    sys.path.append(ghcompfolder)

try:
    from Alpaca4d import alpaca4d as alpaca
except:
    msg = "Cannot import Alpaca4d. Is the Alpaca4d folder available in " + ghcompfolder + "?"
    ghenv.Component.AddRuntimeMessage(gh.Kernel.GH_RuntimeMessageLevel.Error, msg)


def linearSeries(x):
    return x



checkData = True

if not linearFactor:
    linearFactor = 1




if checkData:
    timeSeries = alpaca.TimeSeriesLinear(linearFactor)
    
    Graph = []
    
    for x in range(10):
        Graph.append(linearSeries(x * linearFactor))
# ---------- end python_4 ----------

mplane = MeshPlane(Boundary=srfgrid, WidthCount=subtraction, HeightCount=number_slider_3)  # -> flatten(Mesh), Area
explode_3 = Explode(Curve=flatten(split.Negative), Recursive=True)  # -> Segments, flatten(Vertices)
explode_4 = Explode(Curve=flatten(split.Positive), Recursive=True)  # -> Segments, flatten(Vertices)
cull = CullPattern(List=duppt_2, CullPattern=larger.OrEqualTo)
eim = ElasticIsotropicMaterialAlpaca4d()  # -> out, nDMaterial
# ---------- eim: Python ----------
"""
Create a nD Elastic Isotropic Material
-
    Args:
        name:
        E:
        G:
        v:
        rho:
    Returns:
        nDMaterial:
"""

ghenv.Component.Name = "Elastic Isotropic Material (Alpaca4d)"
ghenv.Component.NickName = 'EIM'
ghenv.Component.Message = "Elastic Isotropic Material\n (Alpaca4d)"


import sys
import Rhino.Geometry as rg
import Grasshopper as gh
import copy


## add alpaca install directory to system path

ghcompfolder = gh.Folders.DefaultAssemblyFolder
if ghcompfolder not in sys.path:
    sys.path.append(ghcompfolder)

try:
    from Alpaca4d import alpaca4d as alpaca
except:
    msg = "Cannot import Alpaca4d. Is the Alpaca4d folder available in " + ghcompfolder + "?"
    ghenv.Component.AddRuntimeMessage(gh.Kernel.GH_RuntimeMessageLevel.Error, msg)


checkData = True

if not E:
    checkData = False
    msg = "Input parameter E failed to collect data"
    ghenv.Component.AddRuntimeMessage(gh.Kernel.GH_RuntimeMessageLevel.Warning, msg)

if not G and not v:
    checkData = False
    msg = "Input parameter G or v failed to collect data"
    ghenv.Component.AddRuntimeMessage(gh.Kernel.GH_RuntimeMessageLevel.Warning, msg)

if not rho:
    checkData = False
    msg = "Input parameter rho failed to collect data"
    ghenv.Component.AddRuntimeMessage(gh.Kernel.GH_RuntimeMessageLevel.Warning, msg)

if checkData:
    nDMaterial = alpaca.ElasticIsotropic(name, E, G, rho, v)
# ---------- end eim ----------
duppt_4 = RemoveDuplicatePts(Points=explode_3.Vertices, Tolerance=0.01)
duppt_5 = RemoveDuplicatePts(Points=explode_4.Vertices, Tolerance=0.01)
cull_i = CullIndex(List=mplane.Mesh, Indices="0", Wrap=True)
support_2 = Data(duppt_5)
beam = Data(simplify(split.Negative))
load = Data(duppt_4)
column = Data(flip_3)

# ----
# uniAxial
panel = Panel("80760")
ghpython_script = GhPythonScript(name="S235", E="210", eta=Slider(9.55, range=5..20), G=panel, v="0.3", rho="2500")  # -> out, steel
# ---------- ghpython_script: Python ----------
try:
    from Alpaca4d import alpaca4d as alpaca
except:
    msg = "Cannot import Alpaca4d. Is the Alpaca4d folder available in " + ghcompfolder + "?"
    ghenv.Component.AddRuntimeMessage(gh.Kernel.GH_RuntimeMessageLevel.Error, msg)

steel = alpaca.uniAxialMaterialElastic(name, E, Eneg, eta, G, v, rho)


print(steel.Eneg)



print(steel.write_tcl())
# ---------- end ghpython_script ----------

sb = StandardBrickAlpaca4d()  # -> out, Element; inputs Brick: Mesh, Colour: Color
# ---------- sb: Python ----------
"""
Create a Standard Brick
-
    Args:
        Brick:
        nDMaterial:
        Colour:
    Returns:
        element:
"""

ghenv.Component.Name = "Standard Brick (Alpaca4d)"
ghenv.Component.NickName = 'SB'
ghenv.Component.Message = "Standard Brick\n (Alpaca4d)"


import sys
import Rhino.Geometry as rg
import Grasshopper as gh
import copy


## add alpaca install directory to system path

ghcompfolder = gh.Folders.DefaultAssemblyFolder
if ghcompfolder not in sys.path:
    sys.path.append(ghcompfolder)

try:
    from Alpaca4d import alpaca4d as alpaca
except:
    msg = "Cannot import Alpaca4d. Is the Alpaca4d folder available in " + ghcompfolder + "?"
    ghenv.Component.AddRuntimeMessage(gh.Kernel.GH_RuntimeMessageLevel.Error, msg)


checkData = True

if not Brick:
    checkData = False
    msg = "Input parameter Brick failed to collect data"
    ghenv.Component.AddRuntimeMessage(gh.Kernel.GH_RuntimeMessageLevel.Warning, msg)

if not nDMaterial:
    checkData = False
    msg = "Input parameter nDMaterial failed to collect data"
    ghenv.Component.AddRuntimeMessage(gh.Kernel.GH_RuntimeMessageLevel.Warning, msg)


if checkData:
    Element = alpaca.StdBrick(Brick, nDMaterial, Colour)
# ---------- end sb ----------
dupln = RemoveDuplicateLines(Lines=beam, Tolerance=0.01)
turn = MeshTurn(Mesh=cull_i)

# ----
# Mesh to Shell
# ShellMITC4, ShellNLDKGT
python_5 = GhPythonScript(Mesh=turn, CrossSection=python_2.fiberSection)  # -> out, Shell; inputs Mesh: Mesh, Colour: Color
# ---------- python_5: Python ----------
"""
Create a support
-
    Args:
        Mesh:
        CrossSection:
        Colour:
    Returns:
        Shell:
"""


import sys
import Rhino.Geometry as rg
import Grasshopper as gh
import copy
from System.Drawing import Color


## add alpaca install directory to system path

ghcompfolder = gh.Folders.DefaultAssemblyFolder
if ghcompfolder not in sys.path:
    sys.path.append(ghcompfolder)

try:
    from Alpaca4d import alpaca4d as alpaca
except:
    msg = "Cannot import Alpaca4d. Is the Alpaca4d folder available in " + ghcompfolder + "?"
    ghenv.Component.AddRuntimeMessage(gh.Kernel.GH_RuntimeMessageLevel.Error, msg)


checkData = True

if not Mesh:
    checkData = False
    msg = "Input parameter Mesh failed to collect data"
    ghenv.Component.AddRuntimeMessage(gh.Kernel.GH_RuntimeMessageLevel.Warning, msg)

if not CrossSection:
    checkData = False
    msg = "Input parameter CrossSection failed to collect data"
    ghenv.Component.AddRuntimeMessage(gh.Kernel.GH_RuntimeMessageLevel.Warning, msg)

if not Colour:
    Colour = Color.Blue


if checkData:
    
    Mesh.Unweld(0,True)
    explodedMesh = Mesh.ExplodeAtUnweldedEdges()
    if explodedMesh.Length > 0:
        Shell = []
        for mesh in explodedMesh:
            if mesh.Vertices.Count == 4:
                Shell.append(alpaca.ShellMITC4(mesh, copy.deepcopy(CrossSection), Colour))
            elif mesh.Vertices.Count == 3:
                Shell.append(alpaca.ShellNLDKGT(mesh, copy.deepcopy(CrossSection), Colour))
    elif explodedMesh.Length == 0:
        if Mesh.Vertices.Count == 4:
                Shell = alpaca.ShellMITC4(Mesh, copy.deepcopy(CrossSection), Colour)
        elif Mesh.Vertices.Count == 3:
            Shell = alpaca.ShellNLDKGT(Mesh, copy.deepcopy(CrossSection), Colour)
    
    #Vertices = Shell.Mesh.Vertices.ToPoint3dArray()
# ---------- end python_5 ----------

python_6 = GhPythonScript(Mesh=turn, CrossSection=python_2.fiberSection, Colour=ColourSwatch(SwatchColor=RGB(240, 0, 0)))  # -> out, Shell; inputs Mesh: Mesh, Colour: Color; same code as python_5
number_slider_8 = Slider(1, range=0..1)

# ----
# PointLoad
panel_2 = Panel("-1000")
vec = VectorXYZ(XComponent="10", YComponent="0", ZComponent="-300")  # -> Vector, Length
python_7 = GhPythonScript(Pos=cull, Force=vec.Vector, TimeSeries=python_4.timeSeries)  # -> out, PointLoad; inputs Pos: Point3d, Force: Vector3d, Moment: Vector3d
# ---------- python_7: Python ----------
"""
Create a PointLoad
-
    Args:
        Pos:
        Force:
        Moment:
        TimeSeries:
    Returns:
        PointLoad:
"""

import sys
import Rhino.Geometry as rg
import Grasshopper as gh
import copy


## add alpaca install directory to system path

ghcompfolder = gh.Folders.DefaultAssemblyFolder
if ghcompfolder not in sys.path:
    sys.path.append(ghcompfolder)

try:
    from Alpaca4d import alpaca4d as alpaca
except:
    msg = "Cannot import Alpaca4d. Is the Alpaca4d folder available in " + ghcompfolder + "?"
    ghenv.Component.AddRuntimeMessage(gh.Kernel.GH_RuntimeMessageLevel.Error, msg)


checkData = True

if not Pos:
    checkData = False
    msg = "Input parameter Pos failed to collect data"
    ghenv.Component.AddRuntimeMessage(gh.Kernel.GH_RuntimeMessageLevel.Warning, msg)

if not Force:
    Force = rg.Vector3d(0.0,0.0,0.0)

if not Moment:
    Moment = rg.Vector3d(0.0,0.0,0.0)

if not TimeSeries:
    checkData = False
    msg = "Input parameter TimeSeries failed to collect data"
    ghenv.Component.AddRuntimeMessage(gh.Kernel.GH_RuntimeMessageLevel.Warning, msg)


if checkData:
    PointLoad = alpaca.PointLoad(Pos, Force, Moment, TimeSeries)
# ---------- end python_7 ----------

circle_cross_section = CircleCrossSectionAlpaca4d(d=Slider(0.5, range=0..1), t=Slider(0.01, range=0..0.01), material=ghpython_script.steel)  # -> out, CrossSection
# ---------- circle_cross_section: Python ----------
"""
Create a Circle Cross Section
-
    Args:
        secName:
        Area:
        Izz:
        Iyy:
        J:
        alphaY:
        alphaZ:
        material:
    Returns:
        genericSection:
"""


import sys
import Rhino.Geometry as rg
import Grasshopper as gh
import copy


## add alpaca install directory to system path

ghcompfolder = gh.Folders.DefaultAssemblyFolder
if ghcompfolder not in sys.path:
    sys.path.append(ghcompfolder)

try:
    from Alpaca4d import alpaca4d as alpaca
except:
    msg = "Cannot import Alpaca4d. Is the Alpaca4d folder available in " + ghcompfolder + "?"
    ghenv.Component.AddRuntimeMessage(gh.Kernel.GH_RuntimeMessageLevel.Error, msg)


checkData = True

if not d:
    checkData = False
    msg = "Input parameter d failed to collect data"
    ghenv.Component.AddRuntimeMessage(gh.Kernel.GH_RuntimeMessageLevel.Warning, msg)

if not t:
    checkData = False
    msg = "Input parameter t failed to collect data"
    ghenv.Component.AddRuntimeMessage(gh.Kernel.GH_RuntimeMessageLevel.Warning, msg)

if not material:
    checkData = False
    msg = "Input parameter material failed to collect data"
    ghenv.Component.AddRuntimeMessage(gh.Kernel.GH_RuntimeMessageLevel.Warning, msg)



if checkData:
    circleCS = alpaca.CircleCS(d,t,material)
    CrossSection = alpaca.ElasticSection(secName, circleCS.Area(), circleCS.Izz(), circleCS.Iyy(), circleCS.J(), circleCS.alphaY, circleCS.alphaZ, circleCS.material)
    CrossSection.sectionBrep = circleCS.sectionBrep
    CrossSection.crv = circleCS.crv
# ---------- end circle_cross_section ----------
rectangular_cross_section = RectangularCrossSectionAlpaca4d(b=Slider(0.3, range=0..1), h=Slider(0.7, range=0..1), material=ghpython_script.steel)  # -> out, CrossSection
# ---------- rectangular_cross_section: Python ----------
"""
Create a Rectangular Cross Section
-
    Args:
        secName:
        Area:
        Izz:
        Iyy:
        J:
        alphaY:
        alphaZ:
        material:
    Returns:
        genericSection:
"""


import sys
import Rhino.Geometry as rg
import Grasshopper as gh
import copy


## add alpaca install directory to system path

ghcompfolder = gh.Folders.DefaultAssemblyFolder
if ghcompfolder not in sys.path:
    sys.path.append(ghcompfolder)

try:
    from Alpaca4d import alpaca4d as alpaca
except:
    msg = "Cannot import Alpaca4d. Is the Alpaca4d folder available in " + ghcompfolder + "?"
    ghenv.Component.AddRuntimeMessage(gh.Kernel.GH_RuntimeMessageLevel.Error, msg)


checkData = True

if not b:
    checkData = False
    msg = "Input parameter b failed to collect data"
    ghenv.Component.AddRuntimeMessage(gh.Kernel.GH_RuntimeMessageLevel.Warning, msg)

if not h:
    checkData = False
    msg = "Input parameter h failed to collect data"
    ghenv.Component.AddRuntimeMessage(gh.Kernel.GH_RuntimeMessageLevel.Warning, msg)

if not material:
    checkData = False
    msg = "Input parameter material failed to collect data"
    ghenv.Component.AddRuntimeMessage(gh.Kernel.GH_RuntimeMessageLevel.Warning, msg)



if checkData:
    rectCS = alpaca.RectangularCS(b,h,material)
    CrossSection = alpaca.ElasticSection(secName, rectCS.Area(), rectCS.Izz(), rectCS.Iyy(), rectCS.J(), rectCS.alphaY, rectCS.alphaZ, rectCS.material)
    CrossSection.sectionBrep = rectCS.sectionBrep
    CrossSection.crv = rectCS.crv
# ---------- end rectangular_cross_section ----------
ssp = SSPBrickAlpaca4d(Brick=mstb, nDMaterial=python.nDMaterial)  # -> out, Element; inputs Brick: Mesh, Colour: Color
# ---------- ssp: Python ----------
"""
Create a Stabilized Single Point Brick (SSPbrick)
-
    Args:
        Brick:
        nDMaterial:
        Colour:
    Returns:
        element:
"""

ghenv.Component.Name = "SSP brick (Alpaca4d)"
ghenv.Component.NickName = 'SSP'
ghenv.Component.Message = "SSP brick (Alpaca4d)"


import sys
import Rhino.Geometry as rg
import Grasshopper as gh
import copy


## add alpaca install directory to system path

ghcompfolder = gh.Folders.DefaultAssemblyFolder
if ghcompfolder not in sys.path:
    sys.path.append(ghcompfolder)

try:
    from Alpaca4d import alpaca4d as alpaca
except:
    msg = "Cannot import Alpaca4d. Is the Alpaca4d folder available in " + ghcompfolder + "?"
    ghenv.Component.AddRuntimeMessage(gh.Kernel.GH_RuntimeMessageLevel.Error, msg)


checkData = True

if not Brick:
    checkData = False
    msg = "Input parameter Brick failed to collect data"
    ghenv.Component.AddRuntimeMessage(gh.Kernel.GH_RuntimeMessageLevel.Warning, msg)

if not nDMaterial:
    checkData = False
    msg = "Input parameter nDMaterial failed to collect data"
    ghenv.Component.AddRuntimeMessage(gh.Kernel.GH_RuntimeMessageLevel.Warning, msg)


if checkData:
    Element = alpaca.SSPbrick(Brick,copy.deepcopy(nDMaterial), Colour)
# ---------- end ssp ----------
ghpython_script_2 = GhPythonScript(Line=column, CrossSection=circle_cross_section.CrossSection, Colour=ColourSwatch(SwatchColor=RGB(153, 11, 11)))  # -> out, element; inputs Line: Curve, Colour: Color, Orient: Boolean
# ---------- ghpython_script_2: Python ----------
try:
    from Alpaca4d import alpaca4d as alpaca
except:
    msg = "Cannot import Alpaca4d. Is the Alpaca4d folder available in " + ghcompfolder + "?"
    ghenv.Component.AddRuntimeMessage(gh.Kernel.GH_RuntimeMessageLevel.Error, msg)
import copy


newCrossSection = copy.deepcopy(CrossSection)

if not Colour:
    Colour = Color.Red

if Orient is None:
    Orient = 0.0

element = alpaca.ForceBeamColumn(Line, newCrossSection, Colour, Orient)
# ---------- end ghpython_script_2 ----------
Z_4 = UnitZ(Factor="10")
ghpython_script_3 = GhPythonScript(Line=dupln, CrossSection=rectangular_cross_section.CrossSection, Colour=ColourSwatch(SwatchColor=RGB(255, 223, 64)))  # -> out, flatten(element); inputs Line: Curve, Colour: Color, Orient: Boolean; same code as ghpython_script_2
box = DomainBox(Base=PlaneXY(0, 0, 0), X="5", Y="5", Z="5")
move_7 = Move(Geometry=box, Motion=Z_4)  # -> Geometry, Transform
pop3d = Populate3D(Region=box, Count=100, Seed=1)
pop3d_2 = Populate3D(Region=move_7.Geometry, Count=100, Seed=1)
# tcl
am = AssembleModelAlpaca4d(Element=ssp.Element, Support=support, Load=python_7.PointLoad)  # -> out, AlpacaModel; inputs Element: list, Support: list, Load: list, Constraint: list
# ---------- am: Python ----------
"""
Create a FEA Model
-
    Args:
        Element:
        Support:
        Load:
        Constraint:
    Returns:
        AlpacaModel:
"""

ghenv.Component.Name = "Assemble Model (Alpaca4d)"
ghenv.Component.NickName = 'AM'
ghenv.Component.Message = "Assemble Model (Alpaca4d)"




import os
from Alpaca4d import alpaca4d as alpaca
import ghpythonlib.treehelpers as th
import Rhino.Geometry as rg
import Rhino.Collections as rc
import rhinoscriptsyntax as rs
from collections import defaultdict, OrderedDict
import copy
import time



FolderPath = rs.DocumentPath()
os.chdir(FolderPath)

# create the object model
AlpacaModel = alpaca.Model()


start = time.clock()
#subdivide element per type

for element in Element:
    if element.type == "Beam":
        AlpacaModel.beams.append(element)
    elif element.type == "Shell":
        AlpacaModel.shells.append(element)
    elif element.type == "Brick":
        AlpacaModel.bricks.append(element)

end = time.clock() - start

print("time to subdivide element {}".format(end))

# create a list of unique point
# need to add the rigid constraint

AlpacaModel.getuniquePoints(AlpacaModel.beams, AlpacaModel.shells, AlpacaModel.bricks, AlpacaModel.constraints)


end = time.clock() - end

print("time to get uniquepoints {}".format(end))

#############
# create node and assign to object
#############

if AlpacaModel.uniquePointsThreeNDF:
    AlpacaModel.py.append(alpaca.Model.write3ndf_tcl())
    for point in AlpacaModel.uniquePointsThreeNDF:
        node = alpaca.Node(point)
        node.ndf = 3
        node.setNodeTag(AlpacaModel.cloudPoint)
        AlpacaModel.nodes.append( node )
    
        AlpacaModel.py.append(node.write_tcl())

if AlpacaModel.uniquePointsSixNDF:
    AlpacaModel.py.append(alpaca.Model.write6ndf_tcl())
    for point in AlpacaModel.uniquePointsSixNDF:
        node = alpaca.Node(point)
        node.ndf = 6
        node.setNodeTag(AlpacaModel.cloudPoint)
        AlpacaModel.nodes.append( node )
     
        AlpacaModel.py.append(node.write_tcl())


#################
# create supports
#################

# issue if there are no 3ndf points in the DistanceTo function

for supportNode in Support:
    
    # if the list is empty, skip this operation
    if AlpacaModel.uniquePointsThreeNDF:
        closestPointInThreeNDF = rc.Point3dList.ClosestPointInList(AlpacaModel.uniquePointsThreeNDF, supportNode.Pos)
    
    
    if AlpacaModel.uniquePointsSixNDF:
        closestPointInSixNDF = rc.Point3dList.ClosestPointInList(AlpacaModel.uniquePointsSixNDF, supportNode.Pos)
    
    
    if supportNode.Pos.DistanceTo(closestPointInThreeNDF) < 0.001:
        print("I am in 3ndf")
        supportNode.ndf = 3
        AlpacaModel.threeNDFModel.append(supportNode)
    elif supportNode.Pos.DistanceTo(closestPointInSixNDF) < 0.001:
        supportNode.ndf = 6
        AlpacaModel.sixNDFModel.append(supportNode)
    else:
        raise ValueError('The node at location {0} is not part of the model'.format(supportNode.Pos.ToString()))
    
    supportNode.setNodeTag(AlpacaModel.cloudPoint)
    AlpacaModel.supports.append(supportNode)
    AlpacaModel.py.append(supportNode.write_tcl())


####################
# create constraints
####################


for constraint in Constraint:
    constraint.setNodeTag(AlpacaModel.cloudPoint)
    AlpacaModel.constraints.append(constraint)


# write py file


# assign tag and node Index to element and shell
for index, element in enumerate(Element,1):
    element.setTopologyRTree(AlpacaModel.RTreeCloudPoint)
    element.eleTag = index
    # assign the same eleTag at the rest
    element.setTags()


## load

for item in Load:
    item.setNodeTag(AlpacaModel.cloudPoint)

for item in AlpacaModel.beams:
    AlpacaModel.py.append(item.write_tcl())

for item in AlpacaModel.shells:
    AlpacaModel.py.append(item.write_tcl())

for item in AlpacaModel.bricks:
    AlpacaModel.py.append(item.write_tcl())


for item in Constraint:
    AlpacaModel.py.append(item.write_tcl())


timeSeriesDict = alpaca.TimeSeries.getTimeSeries(Load)[1]

#model.py.append(alpaca.PointLoad.write_tcl(timeSeriesDict))
AlpacaModel.py.append(alpaca.PointLoad.write_tcl(timeSeriesDict,AlpacaModel))
# ---------- end am ----------
item_2 = ListItem(List=pop3d_2, Index=0, Wrap=True)
toggle_3 = BooleanToggle(True)
support_3 = SupportAlpaca4d(Pos=item_2, Tx=toggle_3, Ty=toggle_3, Tz=toggle_3, Rx=toggle_3, Ry=toggle_3, Rz=toggle_3)  # -> Support; inputs Pos: Point3d, Tx: Boolean, Ty: Boolean, Tz: Boolean, Rx: Boolean, Ry: Boolean, Rz: Boolean; same code as support
python_8 = GhPythonScript(uniquePointsThreeNDF=pop3d, uniquePointsSixNDF=pop3d_2, SupportObject=support_3)  # -> out, a; inputs uniquePointsThreeNDF: list of Point3d, uniquePointsSixNDF: list of Point3d, SupportObject: list
# ---------- python_8: Python ----------
import Rhino.Collections as rc

class Support(object):
    def __init__(self, Pos, Tx = False, Ty = False, Tz = False, Rx = False, Ry = False, Rz = False):
        
        """Generate a Support Boundary Condition
            Inputs:
                Pos: Point Position.
                Tx =
                Ty = 
                Tz = 
                Mx = 
                My = 
                Mz = """
        
        self.Pos = Pos
        
        self.Tx = int(Tx)
        self.Ty = int(Ty)
        self.Tz = int(Tz)
        self.Rx = int(Rx)
        self.Ry = int(Ry)
        self.Rz = int(Rz)
        
        self.nodeTag = None

        self.ndf = None


    def setNodeTag(self, cloudPoint):
        self.nodeTag = cloudPoint.ClosestPoint(self.Pos) + 1
        pass

    def setNodeTagRTree(self, RTreeCloudPoint):
        closestIndices = []
        
        #event handler of type RTreeEventArgs
        def SearchCallback(sender, e):
            closestIndices.Add(e.Id)
        
        RTreeCloudPoint.Search(rg.Sphere(self.Pos, 0.001), SearchCallback)
        ind = closestIndices
        
        self.nodeTag = ind[0]
        pass

    ## override Rhino .ToString() method (display name of the class in Gh)
    def ToString(self):
        return "fix {} {} {} {} {} {} {}".format(self.nodeTag, self.Tx, self.Ty, self.Tz, self.Rx, self.Ry, self.Rz)

    def write_tcl(self):
        if self.ndf == 6:
            tcl_text = "fix {} {} {} {} {} {} {}".format(self.nodeTag, self.Tx, self.Ty, self.Tz, self.Rx, self.Ry, self.Rz)
        elif self.ndf == 3:
            tcl_text = "fix {} {} {} {}".format(self.nodeTag, self.Tx, self.Ty, self.Tz)
        else:
            raise ValueError('No ndf has been assigned')
        return tcl_text

    def write_py(self):
        if self.ndf == 6:
            py_text = "ops.fix({},{},{},{},{},{},{})".format(self.nodeTag, self.Tx, self.Ty, self.Tz, self.Rx, self.Ry, self.Rz)
        elif self.ndf == 3:
            py_text = "ops.fix({},{},{},{})".format(self.nodeTag, self.Tx, self.Ty, self.Tz)
        else:
            raise ValueError('No ndf has been assigned')
        return py_text



#################
# create supports
#################

sixNDFModel = []

for supportNode in SupportObject:
    
    # if the list is empty, skip this operation
    if uniquePointsThreeNDF:
        closestPointInThreeNDF = rc.Point3dList.ClosestPointInList(uniquePointsThreeNDF, supportNode.Pos)
    
    
    if uniquePointsSixNDF:
        closestPointInSixNDF = rc.Point3dList.ClosestPointInList(uniquePointsSixNDF, supportNode.Pos)
    
    
    if supportNode.Pos.DistanceTo(closestPointInThreeNDF) < 0.001:
        print("I am in 3ndf")
        supportNode.ndf = 3
        threeNDFModel.append(supportNode)
    elif supportNode.Pos.DistanceTo(closestPointInSixNDF) < 0.001:
        supportNode.ndf = 6
        sixNDFModel.append(supportNode)
    else:
        raise ValueError('The node at location {0} is not part of the model'.format(supportNode.Pos.ToString()))
    
    supportNode.setNodeTag(cloudPoint)
    supports.append(supportNode)
# ---------- end python_8 ----------
as = AnalysisSettingsAlpaca4d(Algorithm="KrylovNewton", AnalysisSteps="5")  # -> out, Analysis
# ---------- as: Python ----------
"""
Create Analysis settings
-
    Args:
        Constraint: 'Plain', 'Transformation'. Default is 'Transformation'.
        Numberer: 'RCM', 'AMD', 'Plain'. Default is 'RCM'.
        System: 'BandGen', 'BandSPD', 'ProfileSPD', 'SuperLU', 'UmfPack', 'FullGeneral', 'SparseSYM'. Default is 'BandSPD'.
        Test: Feature not implemented. Please contact alpaca4d@gmail.com 
        Algorithm: 'Linear', 'Newton', 'NewtonLineSearch', 'ModifiedNewton', 'KrylovNewton', 'SecantNewton', 'BFGS', 'Broyden'. Default is 'Linear'.
        Integrator: Default is LoadControl.
        AnalysisType: 'Static', 'Transient'. Default is 'Static'.
        AnalyesSteps:
    Returns:
        Analysis:
"""

import sys
import os


import clr
import clrtype
import Rhino.Geometry as rg
import rhinoscriptsyntax as rs
import Grasshopper as gh
import copy
import ghpythonlib.treehelpers as th


ghenv.Component.Name = "Analysis settings (Alpaca4d)"
ghenv.Component.NickName = 'AS'
ghenv.Component.Message = "Analysis settings \n(Alpaca4d)"



from Alpaca4d import alpaca4d as alpaca

checkData = True


# default Value
Constraint = 'Transformation' if Constraint is None else Constraint
ConstraintList = ['Plain', 'Transformation']

for item in ConstraintList:
    if Constraint.lower() == item.lower():
        print(item)
        Constraint = item


# default Value
Numberer = 'RCM' if Numberer is None else Numberer
NumbererList = ['RCM', 'AMD', 'Plain', 'ParallelPlain', 'ParallelRCM']

for i,item in enumerate(NumbererList):
    if Numberer.lower() == item.lower():
        Numberer = item



# default Value
System = 'BandSPD' if System is None else System
SystemList = ['BandGen', 'BandSPD', 'ProfileSPD', 'SuperLU', 'UmfPack', 'FullGeneral', 'SparseSYM']

for i,item in enumerate(SystemList):
    if System.lower() == item.lower():
        System = item


# default Test
Test = 'NormDispIncr 1.0e-6 12 5' if Test is None else Test




# default Value
Algorithm = 'Linear' if Algorithm is None else Algorithm
AlgorithmList = ['Linear', 'Newton', 'NewtonLineSearch', 'ModifiedNewton', 'KrylovNewton', 'SecantNewton', 'BFGS', 'Broyden']

for i,item in enumerate(AlgorithmList):
    if Algorithm.lower() == item.lower():
        Algorithm = item


# default Value
AnalysisType = 'Static' if AnalysisType is None else AnalysisType
AnalysisTypeList = ['Static', 'Transient']

for item in AnalysisTypeList:
    if AnalysisType.lower() == item.lower():
        AnalysisType = item


## Define Integrator
if AnalysisType == "Static":
    Integrator = "LoadControl 1.0" if Integrator is None else Integrator
elif AnalysisType == "Transien":
    Integrator = "Newmark 0.5 0.25" if Integrator is None else Integrator



if not AnalysisSteps:
    checkData = False
    msg = "Input parameter AnalysisSteps failed to collect data"
    ghenv.Component.AddRuntimeMessage(gh.Kernel.GH_RuntimeMessageLevel.Warning, msg)


if checkData:
    Analysis = alpaca.Analysis(Constraint, Numberer,System,Test,Algorithm,Integrator,AnalysisType, AnalysisSteps)
    print(Analysis.write_tcl())
# ---------- end as ----------
ra = RunAnalysisAlpaca4d(AlpacaModel=am.AlpacaModel, Analysis=as.Analysis)  # -> out, AlpacaSolvedModel; disabled
# ---------- ra: Python ----------
"""
Run an OpenSees Analysis
-
    Args:
        AlpacaModel:
        Analysis:
    Returns:
        AlpacaSolvedModel:
"""



import Rhino.RhinoDoc
import Grasshopper as gh
import copy
import rhinoscriptsyntax as rs
import os
import time
import sys



ghenv.Component.Name = "Run Analysis (Alpaca4d)"
ghenv.Component.NickName = 'RA'
ghenv.Component.Message = "Run Analysis \n(Alpaca4d)"

ghcompfolder = gh.Folders.DefaultAssemblyFolder
if ghcompfolder not in sys.path:
    sys.path.append(ghcompfolder)

try:
    from Alpaca4d import alpaca4d as alpaca
except:
    msg = "Cannot import Alpaca4d. Is the Alpaca4d folder available in " + ghcompfolder + "?"
    ghenv.Component.AddRuntimeMessage(gh.Kernel.GH_RuntimeMessageLevel.Error, msg)


checkData = True



if not AlpacaModel:
    checkData = False
    msg = "Input parameter AlpacaModel failed to collect data"
    ghenv.Component.AddRuntimeMessage(gh.Kernel.GH_RuntimeMessageLevel.Warning, msg)


if not Analysis:
    checkData = False
    msg = "Input parameter Analysis failed to collect data"
    ghenv.Component.AddRuntimeMessage(gh.Kernel.GH_RuntimeMessageLevel.Warning, msg)


if checkData:
    FolderPath = rs.DocumentPath()
    os.chdir(FolderPath)
    
    outputFileName = 'openSeesModel'
    
    for dirpath, dirnames, filenames in os.walk(FolderPath):
        for filename in filenames:
            if filename == outputFileName:
                file = os.path.join(dirpath,outputFileName)
                os.remove(file)
    
    
    # create a copy
    
    AnalysisModel = copy.copy(AlpacaModel)
    AnalysisModel.py = list(AnalysisModel.py)
    
    # generate Recorder and assign name
    AnalysisModel.recorderName = "recorder" + ".mpco"
    
    AnalysisModel.py.append(alpaca.TCLRecorder.mpco(AnalysisModel.recorderName, True,True,True,True,False,False,True,True,True,True))
    
    
    AnalysisModel.analysis = Analysis
    AnalysisModel.py.append(Analysis.write_tcl())
    #AnalysisModel.StaticAnalysis(numIncr)
    AnalysisModel.py.append("wipe")
    
    
    #textFile = AnalysisModel.py
    
    time_start = time.clock()
    
    AnalysisModel.writeFile(outputFileName)
    
    time_elapsed = (time.clock() - time_start)
    print("Writing Time {}".format(time_elapsed))
    
    
    
    time_start = time.clock()
    
    executable = os.path.join(ghcompfolder,'Alpaca4d\OpenSees-Solvers\opensees.bat')
    a, msg = AnalysisModel.runOpensees(executable)
    
    time_elapsed = (time.clock() - time_start)
    print("Analyses Time {}".format(time_elapsed))
    
    
    AlpacaSolvedModel = copy.copy(AnalysisModel)
#ghenv.Component.AddRuntimeMessage(gh.Kernel.GH_RuntimeMessageLevel.Error, msg)
# ---------- end ra ----------

# ---- group: ViewModel
panel_3 = Panel("0.001")  # disabled
number_slider_9 = Slider(0.01, range=0..0.01)  # disabled
number_slider_10 = Slider(1.51, range=0..2)  # disabled
toggle_4 = BooleanToggle(True)  # disabled
toggle_5 = BooleanToggle(False)  # disabled
toggle_6 = BooleanToggle(False)  # disabled
toggle_7 = BooleanToggle(False)  # disabled
python_9 = GhPythonScript(PointLoad=python_7.PointLoad, scale=panel_3)  # -> out, Force, Moment; inputs PointLoad: list; disabled
# ---------- python_9: Python ----------
__author__ = "domy7"
__version__ = "2021.03.21"

import rhinoscriptsyntax as rs
import Rhino.Geometry as rg

def DrawVector( PointLoadClass, c1, viewType, color ):
    if c1 is None:
        c1 = 0.0001
    c = 0.25
    c2 = 0.1
    
    vectorDraw = []
    for iPLoad in PointLoadClass:
        if viewType is not False:
            forceType = iPLoad.Moment
        else:
            forceType = iPLoad.Force
            
        l = forceType.Length*c1
        l1 = forceType.Length*c1*c
        l2 = forceType.Length*c1*c2
        
        planeLoad =rg.Plane( iPLoad.Pos, -forceType )
        point0 = rg.Point3d.Add( iPLoad.Pos, planeLoad.ZAxis*l1)
        point1 =rg.Point3d.Add(point0, planeLoad.XAxis*l2 + planeLoad.YAxis*l2)
        point2 =rg.Point3d.Add(point0, planeLoad.XAxis*l2 - planeLoad.YAxis*l2)
        point3 =rg.Point3d.Add(point0, -planeLoad.XAxis*l2 - planeLoad.YAxis*l2)
        point4 = rg.Point3d.Add( point0, -planeLoad.XAxis*l2 + planeLoad.YAxis*l2)
        #Mesh Puntatore 
        Arrow = rg.Mesh()
        Arrow.Vertices.Add( iPLoad.Pos ) #0
        Arrow.Vertices.Add( point1 ) #1
        Arrow.Vertices.Add( point2 ) #2
        Arrow.Vertices.Add( point3 ) #3
        Arrow.Vertices.Add( point4 ) #4
        Arrow.Faces.AddFace( 0, 1, 2 ) 
        Arrow.Faces.AddFace( 0, 2, 3 )
        Arrow.Faces.AddFace( 0, 3, 4 )
        Arrow.Faces.AddFace( 0, 4, 1 )
        Arrow.Faces.AddFace( 1, 2, 3, 4)
        
        #Mesh Coda 
        point0 = rg.Point3d.Add( iPLoad.Pos, planeLoad.ZAxis*l)
        point1 =rg.Point3d.Add(point0, planeLoad.XAxis*l2*0.5 + planeLoad.YAxis*l2*0.5)
        point2 =rg.Point3d.Add(point0, planeLoad.XAxis*l2*0.5 - planeLoad.YAxis*l2*0.5)
        point3 =rg.Point3d.Add(point0, -planeLoad.XAxis*l2*0.5 - planeLoad.YAxis*l2*0.5)
        point4 = rg.Point3d.Add( point0, -planeLoad.XAxis*l2*0.5 + planeLoad.YAxis*l2*0.5)
        Arrow.Vertices.Add( point1 ) #5
        Arrow.Vertices.Add( point2 ) #6
        Arrow.Vertices.Add( point3 ) #7
        Arrow.Vertices.Add( point4 ) #8
        Arrow.Faces.AddFace( 0, 5, 6 ) 
        Arrow.Faces.AddFace( 0, 6, 7 )
        Arrow.Faces.AddFace( 0, 7, 8 )
        Arrow.Faces.AddFace( 0, 8, 5 )
        Arrow.Faces.AddFace( 5, 6, 7, 8)
        Arrow.VertexColors.CreateMonotoneMesh( color )
        vectorDraw.append( Arrow )
    return vectorDraw 

colour1 = rs.CreateColor( 255, 255, 255 )
colour2 = rs.CreateColor( 255, 100, 0 )
Force = DrawVector( PointLoad, scale, False, colour1)
Moment = DrawVector( PointLoad, scale, True, colour2)
# ---------- end python_9 ----------
python_10 = GhPythonScript(model=am.AlpacaModel, type=toggle_4, nodeTag=toggle_5, eleTag=toggle_6, localAxis=toggle_7)  # inputs type: Boolean, nodeTag: Boolean, eleTag: Boolean, localAxis: Boolean; disabled
# ---------- python_10: Python ----------
from ghpythonlib.componentbase import executingcomponent as component
import Grasshopper, GhPython
import System
import Rhino as rc
import rhinoscriptsyntax as rs
import sys
import Rhino.Geometry as rg
import Grasshopper as gh
import copy

ghcompfolder = gh.Folders.DefaultAssemblyFolder
if ghcompfolder not in sys.path:
    sys.path.append(ghcompfolder)
try:
    from Alpaca4d import alpaca4dView as alpacaView
except:
    msg = "Cannot import Alpaca4d. Is the Alpaca4d folder available in " + ghcompfolder + "?"
    ghenv.Component.AddRuntimeMessage(gh.Kernel.GH_RuntimeMessageLevel.Error, msg)

checkData = True

class MyComponent(component):
    
    def RunScript(self, model, type, nodeTag, eleTag, localAxis):
        
        self.type = type
        self.model = model
        self.nodeTag = nodeTag
        ## add alpaca install directory to system path
        
        self.ModelBeam = alpacaView.ViewBeam( model, type)
        self.ModelShell = alpacaView.ViewShell( model, type )
        #NODE TAG VIEW
        if nodeTag is True:
            self.Nodes = [ [inode.nodeTag, inode.Pos] for inode in self.model.nodes]
        else:
            self.Nodes = []
        #ELE TAG VIEW
        if eleTag is True:
            TagBeam = [ [item.eleTag, item.getPerpFrame().Origin] for item in self.model.beams]
            TagShell = [ [item.eleTag, rg.AreaMassProperties.Compute( item.Mesh, False, True, False, False ).Centroid] for item in self.model.shells]
            self.TagEle = TagBeam + TagShell
        else:
            self.TagEle = []
        #LOCAL AXIS
        if localAxis is True:
            self.localAxis = [ item.getPerpFrame() for item in self.model.beams]
        else:
            self.localAxis = []
           
            
    def DrawViewportWires(self,arg):
        # Beam
        for iBeam in self.ModelBeam:
            color = iBeam[1]
            colorMaterial = rc.Display.DisplayMaterial(color, 0.3)
            if self.type is True:
                colorWirframe = System.Drawing.Color.Gray
                #System.Drawing.Color.LightGray
                arg.Display.DrawBrepShaded(iBeam[0], colorMaterial)
                arg.Display.DrawBrepWires(iBeam[0], colorWirframe)
            else :
                thickness =2
                arg.Display.DrawCurve(iBeam[0], color, thickness)
        # Mesh
        for iShell in self.ModelShell:
            color = iShell[1]
            #color = System.Drawing.Color.Blue
            colorMaterial = rc.Display.DisplayMaterial(color,color,color,color,1,0.00)
            colorMaterial.IsTwoSided = True
            arg.Display.DrawMeshShaded(iShell[0], colorMaterial)
            colorWirframe = System.Drawing.Color.Black
            arg.Display.DrawMeshWires(iShell[0], colorWirframe)
        # node Tag view
        for inode in self.Nodes:
            arg.Display.Draw2dText( str(inode[0]), System.Drawing.Color.DarkSlateBlue, inode[1], True, 50)
        # ele Tag view
        for iEle in self.TagEle:
            arg.Display.Draw2dText( str(iEle[0]), System.Drawing.Color.BlanchedAlmond, iEle[1], True, 50)
        # local Axis
        for iLocalAxis in self.localAxis:
            arg.Display.DrawArrow( rg.Line(iLocalAxis.Origin, iLocalAxis.XAxis), System.Drawing.Color.Red)
            arg.Display.DrawArrow( rg.Line(iLocalAxis.Origin, iLocalAxis.YAxis), System.Drawing.Color.Green)
            arg.Display.DrawArrow( rg.Line(iLocalAxis.Origin, iLocalAxis.ZAxis), System.Drawing.Color.Blue)
# ---------- end python_10 ----------
python_11 = GhPythonScript(model=am.AlpacaModel, scale=number_slider_10)  # disabled
# ---------- python_11: Python ----------
from ghpythonlib.componentbase import executingcomponent as component
import Grasshopper, GhPython
import System
import Rhino as rc
import rhinoscriptsyntax as rs

class MyComponent(component):
    
    def RunScript(self, model, scale):
        import sys
        import Rhino.Geometry as rg
        import Grasshopper as gh
        import copy
        import rhinoscriptsyntax as rs
        import System.Drawing.Color
        import Rhino
        import math as mt
        
        self.model = model
        self.scale = scale
        
        ghcompfolder = gh.Folders.DefaultAssemblyFolder
        if ghcompfolder not in sys.path:
            sys.path.append(ghcompfolder)
        
        try:
            from Alpaca4d import alpaca4dView as alpacaView
        except:
            msg = "Cannot import Alpaca4d. Is the Alpaca4d folder available in " + ghcompfolder + "?"
            ghenv.Component.AddRuntimeMessage(gh.Kernel.GH_RuntimeMessageLevel.Error, msg)
        
        self.solidSupport = [ alpacaView.Support( iSupport, self.scale ) for iSupport in self.model.supports ]
        
    def DrawViewportWires(self,arg):
        # Support
        color = System.Drawing.Color.Azure
        colorWirframe = System.Drawing.Color.Black
        colorMaterial = rc.Display.DisplayMaterial(color, 0.0)
        for iSupport in self.solidSupport :
            arg.Display.DrawBrepShaded( iSupport, colorMaterial)
            arg.Display.DrawBrepWires( iSupport, colorWirframe)
# ---------- end python_11 ----------

# ----
number_slider_11 = Slider(0.01, range=0..0.01)  # disabled

# ---- group: CDS
number_slider_12 = Slider(1, range=0..10)  # disabled
number_slider_13 = Slider(0, range=0..10)  # disabled
number_slider_14 = Slider(3, range=0..100)  # disabled
toggle_8 = BooleanToggle(True)  # disabled
toggle_9 = BooleanToggle(False)  # disabled
bfd = BeamForcesDiagramAlpaca4d(
    AlpacaModel=ra.AlpacaSolvedModel,
    step=number_slider_13,
    cdsType=number_slider_12,
    scale=number_slider_11,
    viewValor=toggle_8)  # -> ForcesDiagram; inputs step: Int32, cdsType: Int32; disabled
# ---------- bfd: Python ----------
"""
View Diagram of internal beam forces

    Args:
        AlpacaModel:
        cdsType: 
    0: to view N (forces in direction 3)
    1: to view M2 (Moments around axis 2)
    2: to view T1 (forces in direction 1)
    3: to view M1 (Moments around axis 1)
    4: to view T2 (forces in direction 2)
    5: to view Mt (Moments around axis 3)
        step:
        scale: scalar view
        viewValor: to view tthe force value
    Returns:
        ForcesDiagram: Diagram of internal beam forces
"""


ghenv.Component.Name = "BeamForcesDiagram (Alpaca4d)"
ghenv.Component.NickName = 'BFD'
ghenv.Component.Message = "Beam Forces Diagram \n(Alpaca4d)"

from ghpythonlib.componentbase import executingcomponent as component
import Grasshopper, GhPython
import rhinoscriptsyntax as rs
import sys
import os
import System
import clr
import Rhino.Geometry as rg
import Grasshopper as gh
import copy
import Rhino


from Alpaca4d import alpaca4d as alpaca
from Alpaca4d import alpaca4dView as alpacaView
FolderPath = rs.DocumentPath()
os.chdir(FolderPath)

ghcompfolder = gh.Folders.DefaultAssemblyFolder
if ghcompfolder not in sys.path:
    sys.path.append(ghcompfolder)

# import costum modules to read the hdf5 file
my_module_name = "Alpaca_StepReader"
my_module = sys.modules.setdefault(my_module_name, type(sys)(my_module_name))

hdfFilePath = os.path.join(ghcompfolder, "Alpaca4d\HDF5CSharp.dll")
clr.AddReferenceToFileAndPath(hdfFilePath)

from HDF5CSharp import Hdf5

try:
    Steps = my_module.Steps
except AttributeError:
    type_2d = type(System.Array.CreateInstance(float, 1, 1))

    class Steps(object):
        __metaclass__ = clrtype.ClrClass
        _clrfields = {"STEP_{}".format(i): type_2d for i in range(1000)} # it will work for model with less than 1000 steps
    
    my_module.Steps = Steps

checkData = True

class MyComponent(component):
    
    def RunScript(self, AlpacaModel, step, cdsType, scale, viewValor):
        
        self.AlpacaModel = AlpacaModel
        self.step = step
        self.cdsType = cdsType
        self.scale = scale 
        self.viewValor = viewValor
            
        fileId = Hdf5.OpenFile(self.AlpacaModel.recorderName, True)
        
        stressResult = Hdf5.ReadObject[Steps](fileId, "/MODEL_STAGE[1]/RESULTS/ON_ELEMENTS/section.force/74-ForceBeamColumn3d[1000:1:0]/DATA")
        #stressResult = Hdf5.ReadObject[Steps](fileId, "/MODEL_STAGE[1]/RESULTS/ON_ELEMENTS/stresses/167-UnknownMovableObject[103:0:0]/DATA")
        if self.cdsType <= 0:
            versorType, startRange, colorPos, colorNeg = 1, 0, System.Drawing.Color.SteelBlue, System.Drawing.Color.LightSalmon
        elif self.cdsType == 1:
            versorType, startRange, colorPos, colorNeg = 1, 1, System.Drawing.Color.Aqua, System.Drawing.Color.IndianRed
        elif self.cdsType== 2:
            versorType, startRange, colorPos, colorNeg = 1, 2, System.Drawing.Color.LightSalmon, System.Drawing.Color.LightSalmon
        elif self.cdsType == 3:
            versorType, startRange, colorPos, colorNeg = 2, 3, System.Drawing.Color.SteelBlue, System.Drawing.Color.Yellow
        elif self.cdsType == 4:
            versorType, startRange, colorPos, colorNeg = 2, 4, System.Drawing.Color.LawnGreen, System.Drawing.Color.LawnGreen
        else:
            versorType, startRange, colorPos, colorNeg = 2, 5, System.Drawing.Color.BlueViolet, System.Drawing.Color.BlueViolet
            
        CDSView = []
        CDSPoint = []
        CDSValor = []
        
        for i,item in enumerate(self.AlpacaModel.beams):
            ni = 5 # potrebbe cambiare per ogni trave
            #Versore
            e = item.getPerpFrame()[versorType]*-1
            valor = [ getattr(stressResult, 'STEP_{}'.format(self.step))[i,j] for j in range(startRange,ni*6, 6)]
            cdsVector = [ rg.Vector3d.Multiply(e, ivalor*self.scale) for ivalor in valor ]
            #----------------------------------------------------------------#
            cdsView, cdsPoint = alpacaView.cdsMesh( item, cdsVector, colorPos, colorNeg)
            CDSView.append(cdsView)
            CDSPoint.append(cdsPoint)
            CDSValor.append(valor)
            
        self.Pos = CDSPoint
        self.Valor = CDSValor
        self.ForcesDiagram = CDSView
        Hdf5.CloseFile(fileId)

        return self.ForcesDiagram
        
    def DrawViewportWires(self,arg):
        # node Tag view
        for iPos, ivalor, iMesh in zip(self.Pos, self.Valor, self.ForcesDiagram) :
            colorWirframe = System.Drawing.Color.Black
            arg.Display.DrawMeshWires(iMesh, colorWirframe)
            if self.viewValor is True:
                for jpos, jvalor in zip(iPos, ivalor):
                    t = 25
                    txt = str( round( jvalor, 2))
                    arg.Display.Draw2dText( txt, System.Drawing.Color.Black, jpos, True, t)
# ---------- end bfd ----------
bf = BeamForcesAlpaca4d(AlpacaModel=ra.AlpacaSolvedModel, step=number_slider_14, History=toggle_9)  # -> out, N, M2, T1, M1, T2, Mz; inputs step: Int32, History: Boolean; disabled
# ---------- bf: Python ----------
"""
Valor of internal beam forces

    Args:
        AlpacaModel:
        step:
        History:
    Returns:
        N: forces in direction 3  (Axial Force)
        M2: Moments around axis 2 (Bending Moment 1)
        T1: forces in direction 1 (Shear Force 1)
        M1: Moments around axis 1 (Bending Moment 2)
        T2: forces in direction 2 (Shear Force 2)
        Mt: Moments around axis 3 (Twisting Moment)
"""

import sys
import os
import System
from System.Drawing import Color
import clr
import clrtype
import Rhino.Geometry as rg
import rhinoscriptsyntax as rs
import Grasshopper as gh
import copy
import ghpythonlib.treehelpers as th


ghenv.Component.Name = "Beam Forces (Alpaca4d)"
ghenv.Component.NickName = 'BF'
ghenv.Component.Message = "Beam Forces (Alpaca4d)"
## add alpaca install directory to system path

ghcompfolder = gh.Folders.DefaultAssemblyFolder
if ghcompfolder not in sys.path:
    sys.path.append(ghcompfolder)

try:
    from Alpaca4d import alpaca4d as alpaca
except:
    msg = "Cannot import Alpaca4d. Is the Alpaca4d folder available in " + ghcompfolder + "?"
    ghenv.Component.AddRuntimeMessage(gh.Kernel.GH_RuntimeMessageLevel.Error, msg)



FolderPath = rs.DocumentPath()
os.chdir(FolderPath)


# import costum modules to read the hdf5 file

my_module_name = "Alpaca_StepReader"
my_module = sys.modules.setdefault(my_module_name, type(sys)(my_module_name))

hdfFilePath = os.path.join(ghcompfolder, "Alpaca4d\HDF5CSharp.dll")
clr.AddReferenceToFileAndPath(hdfFilePath)

from HDF5CSharp import Hdf5

try:
    Steps = my_module.Steps
except AttributeError:
    type_2d = type(System.Array.CreateInstance(float, 1, 1))

    class Steps(object):
        __metaclass__ = clrtype.ClrClass
        _clrfields = {"STEP_{}".format(i): type_2d for i in range(1000)} # it will work for model with less than 1000 steps

    my_module.Steps = Steps


checkData = True

if not AlpacaModel:
    checkData = False
    msg = "Input parameter AlpacaModel failed to collect data"
    ghenv.Component.AddRuntimeMessage(gh.Kernel.GH_RuntimeMessageLevel.Warning, msg)

if checkData:
    
    step = (int(AlpacaModel.analysis.NumberOfSteps) - 1) if step is None else step
# read result
    
    N = []
    T1 = []
    T2 = []
    M1 = []
    M2 = []
    Mz = []
    
    fileId = Hdf5.OpenFile(AlpacaModel.recorderName, True)
    
    stressResult = Hdf5.ReadObject[Steps](fileId, "/MODEL_STAGE[1]/RESULTS/ON_ELEMENTS/section.force/74-ForceBeamColumn3d[1000:1:0]/DATA")
    #stressResult = Hdf5.ReadObject[Steps](fileId, "/MODEL_STAGE[1]/RESULTS/ON_ELEMENTS/stresses/167-UnknownMovableObject[103:0:0]/DATA")
if History is True:
    
    maxNumberStep = int(AlpacaModel.analysis.NumberOfSteps)
    for istep in range(maxNumberStep):
        for i,item in enumerate(AlpacaModel.beams):
            ni = 5 # potrebbe cambiare per ogni trave
            Ni = [ getattr(stressResult, 'STEP_{}'.format(istep))[i,j] for j in range(0,ni*6, 6)]
            M2i = [ getattr(stressResult, 'STEP_{}'.format(istep))[i,j] for j in range(1,ni*6, 6)]  
            T1i = [ getattr(stressResult, 'STEP_{}'.format(istep))[i,j] for j in range(2,ni*6, 6)]
            M1i = [ getattr(stressResult, 'STEP_{}'.format(istep))[i,j] for j in range(3,ni*6, 6)]
            T2i = [ getattr(stressResult, 'STEP_{}'.format(istep))[i,j] for j in range(4,ni*6, 6)]
            Mzi = [ getattr(stressResult, 'STEP_{}'.format(istep))[i,j] for j in range(5,ni*6, 6)]
            
            N.append([Ni])
            M2.append([M2i])
            T1.append([T1i])
            M1.append([M1i])
            T2.append([T2i])
            Mz.append([Mzi])
else:
    for i,item in enumerate(AlpacaModel.beams):
        ni = 5 # potrebbe cambiare per ogni trave
        Ni = [ getattr(stressResult, 'STEP_{}'.format(step))[i,j] for j in range(0,ni*6, 6)]
        M2i = [ getattr(stressResult, 'STEP_{}'.format(step))[i,j] for j in range(1,ni*6, 6)]  
        T1i = [ getattr(stressResult, 'STEP_{}'.format(step))[i,j] for j in range(2,ni*6, 6)]
        M1i = [ getattr(stressResult, 'STEP_{}'.format(step))[i,j] for j in range(3,ni*6, 6)]
        T2i = [ getattr(stressResult, 'STEP_{}'.format(step))[i,j] for j in range(4,ni*6, 6)]
        Mzi = [ getattr(stressResult, 'STEP_{}'.format(step))[i,j] for j in range(5,ni*6, 6)]
        
        N.append([Ni])
        M2.append([M2i])
        T1.append([T1i])
        M1.append([M1i])
        T2.append([T2i])
        Mz.append([Mzi])
        
Hdf5.CloseFile(fileId)

N = th.list_to_tree(N)
M2 = th.list_to_tree(M2)
T1 = th.list_to_tree(T1)
M1 = th.list_to_tree(M1)
T2 = th.list_to_tree(T2)
Mz = th.list_to_tree(Mz)
# ---------- end bf ----------
graph = QuickGraph(bf.M2, SortOrder=0)  # disabled

# ----
rf = ReactionForcesAlpaca4d(AlpacaModel=ra.AlpacaSolvedModel, History=Toggle(False))  # -> out, SupportPosition, ReactionForce, ReactionMoment; inputs History: Boolean, step: Int32
# ---------- rf: Python ----------
"""
Read Reaction Forces
    Args:
        AlpacaModel:
        History:
        step:
    Returns:
        SupportPosition:
        ReactionForce:
        ReactionMoment:
        ReactionForce_History:
        ReactionMoment_History:
"""

ghenv.Component.Name = "Reaction Forces (Alpaca4d)"
ghenv.Component.NickName = 'RF'
ghenv.Component.Message = 'Reaction Forces\n (Alpaca4d)'


import sys
import os
import System
from System.Drawing import Color


import clr
import clrtype
import Rhino.Geometry as rg
import rhinoscriptsyntax as rs
import Grasshopper as gh
import copy
import ghpythonlib.treehelpers as th



## add alpaca install directory to system path

ghcompfolder = gh.Folders.DefaultAssemblyFolder
if ghcompfolder not in sys.path:
    sys.path.append(ghcompfolder)

try:
    from Alpaca4d import alpaca4d as alpaca
except:
    msg = "Cannot import Alpaca4d. Is the Alpaca4d folder available in " + ghcompfolder + "?"
    ghenv.Component.AddRuntimeMessage(gh.Kernel.GH_RuntimeMessageLevel.Error, msg)



FolderPath = rs.DocumentPath()
os.chdir(FolderPath)

my_module_name = "Alpaca_StepReader" # replace this with something unique that doesn't collide with a real module!
my_module = sys.modules.setdefault(my_module_name, type(sys)(my_module_name))

hdfFilePath = os.path.join(ghcompfolder, "Alpaca4d\HDF5CSharp.dll")
clr.AddReferenceToFileAndPath(hdfFilePath)


from HDF5CSharp import Hdf5

try:
    Steps = my_module.Steps
except AttributeError:
    type_2d = type(System.Array.CreateInstance(float, 1, 1))

    class Steps(object):
        __metaclass__ = clrtype.ClrClass
        _clrfields = {"STEP_{}".format(i): type_2d for i in range(1000)} # it will work for model with less than 1000 steps

    my_module.Steps = Steps



checkData = True

if not AlpacaModel:
    checkData = False
    msg = "Input parameter AlpacaModel failed to collect data"
    ghenv.Component.AddRuntimeMessage(gh.Kernel.GH_RuntimeMessageLevel.Warning, msg)



History = False if History is None else History


if checkData:
    step = (int(AlpacaModel.analysis.NumberOfSteps) - 1) if step is None else step
    supportTagLocation = [item.nodeTag - 1 for item in AlpacaModel.supports] #
    
    if not History:
    
        try:
            fileId = Hdf5.OpenFile(AlpacaModel.recorderName, True)
            
            
            reactionForceResult = Hdf5.ReadObject[Steps](fileId, "/MODEL_STAGE[1]/RESULTS/ON_NODES/REACTION_FORCE/DATA")
            ReactionForce = []
            for i in supportTagLocation:
                x = getattr(reactionForceResult, 'STEP_{}'.format(step))[i,0]
                y = getattr(reactionForceResult, 'STEP_{}'.format(step))[i,1]
                z = getattr(reactionForceResult, 'STEP_{}'.format(step))[i,2]
                ReactionForce.append(rg.Vector3d(x,y,z))
            
            
            ReactionMomentResult = Hdf5.ReadObject[Steps](fileId, "/MODEL_STAGE[1]/RESULTS/ON_NODES/REACTION_MOMENT/DATA")
            ReactionMoment = []
            for i in supportTagLocation:
                x = getattr(ReactionMomentResult, 'STEP_{}'.format(step))[i,0]
                y = getattr(ReactionMomentResult, 'STEP_{}'.format(step))[i,1]
                z = getattr(ReactionMomentResult, 'STEP_{}'.format(step))[i,2]
                ReactionMoment.append(rg.Vector3d(x,y,z))
                
            Hdf5.CloseFile(fileId)
            
        except:
            if fileId >0:
                Hdf5.CloseFile(fileId)
                print("I have closed the file")
    
    
    if History:
        try:
            fileId = Hdf5.OpenFile(AlpacaModel.recorderName, True)
        
            maxNumberStep = int(AlpacaModel.analysis.NumberOfSteps)
            
            reactionForceResult = Hdf5.ReadObject[Steps](fileId, "/MODEL_STAGE[1]/RESULTS/ON_NODES/REACTION_FORCE/DATA")
            ReactionForce = []
            for i in supportTagLocation:
                reactionForceTemp = []
                for n_step in range(maxNumberStep):
                    x = getattr(reactionForceResult, 'STEP_{}'.format(n_step))[i,0]
                    y = getattr(reactionForceResult, 'STEP_{}'.format(n_step))[i,1]
                    z = getattr(reactionForceResult, 'STEP_{}'.format(n_step))[i,2]
                    reactionForceTemp.append(rg.Vector3d(x,y,z))
            
                ReactionForce.append(reactionForceTemp)
    
    
            reactionMomentResult = Hdf5.ReadObject[Steps](fileId, "/MODEL_STAGE[1]/RESULTS/ON_NODES/REACTION_MOMENT/DATA")
            ReactionMoment = []
            for i in supportTagLocation:
                reactionMomentTemp = []
                for n_step in range(maxNumberStep):
                    x = getattr(reactionMomentResult, 'STEP_{}'.format(n_step))[i,0]
                    y = getattr(reactionMomentResult, 'STEP_{}'.format(n_step))[i,1]
                    z = getattr(reactionMomentResult, 'STEP_{}'.format(n_step))[i,2]
                    reactionMomentTemp.append(rg.Vector3d(x,y,z))
            
                ReactionMoment.append(reactionMomentTemp)
            Hdf5.CloseFile(fileId)
            
        except:
            Hdf5.CloseFile(fileId)
    
    
    
    
    SupportPosition = [item.Pos for item in AlpacaModel.supports]
    ReactionForce = th.list_to_tree(ReactionForce)
    ReactionMoment = th.list_to_tree(ReactionMoment)
# ---------- end rf ----------
nd = NodalDisplacementsAlpaca4d(AlpacaModel=ra.AlpacaSolvedModel, History=Toggle(False))  # -> out, displacement, rotation; inputs History: Boolean, step: Int32
# ---------- nd: Python ----------
"""
Read displacement results
-
    Args:
        AlpacaModel:
        History: True to visualise the displacement and rotation history of the points
        step:
    Returns:
        displacement:
        rotation:
        displacement_History:
        rotation_History:
"""

ghenv.Component.Name = "Nodal Displacements (Alpaca4d)"
ghenv.Component.NickName = 'ND'
ghenv.Component.Message = "Nodal Displacements\n (Alpaca4d)"

import sys
import os
import System
from System.Drawing import Color


import clr
import clrtype
import Rhino.Geometry as rg
import rhinoscriptsyntax as rs
import Grasshopper as gh
import copy
import ghpythonlib.treehelpers as th



## add alpaca install directory to system path

ghcompfolder = gh.Folders.DefaultAssemblyFolder
if ghcompfolder not in sys.path:
    sys.path.append(ghcompfolder)

try:
    from Alpaca4d import alpaca4d as alpaca
except:
    msg = "Cannot import Alpaca4d. Is the Alpaca4d folder available in " + ghcompfolder + "?"
    ghenv.Component.AddRuntimeMessage(gh.Kernel.GH_RuntimeMessageLevel.Error, msg)



FolderPath = rs.DocumentPath()
os.chdir(FolderPath)

my_module_name = "Alpaca_StepReader" # replace this with something unique that doesn't collide with a real module!
my_module = sys.modules.setdefault(my_module_name, type(sys)(my_module_name))

hdfFilePath = os.path.join(ghcompfolder, "Alpaca4d\HDF5CSharp.dll")
clr.AddReferenceToFileAndPath(hdfFilePath)


from HDF5CSharp import Hdf5

try:
    Steps = my_module.Steps
except AttributeError:
    type_2d = type(System.Array.CreateInstance(float, 1, 1))

    class Steps(object):
        __metaclass__ = clrtype.ClrClass
        _clrfields = {"STEP_{}".format(i): type_2d for i in range(1000)} # it will work for model with less than 1000 steps

    my_module.Steps = Steps



checkData = True

if not AlpacaModel:
    checkData = False
    msg = "Input parameter AlpacaModel failed to collect data"
    ghenv.Component.AddRuntimeMessage(gh.Kernel.GH_RuntimeMessageLevel.Warning, msg)



History = False if History is None else History


if checkData:
    step = (int(AlpacaModel.analysis.NumberOfSteps) - 1) if step is None else step
    numberOfPoints = len(AlpacaModel.uniquePoints) #
    
    if not History:
        try:
            fileId = Hdf5.OpenFile(AlpacaModel.recorderName, True)
            
            
            displacementResult = Hdf5.ReadObject[Steps](fileId, "/MODEL_STAGE[1]/RESULTS/ON_NODES/DISPLACEMENT/DATA")
            displacement = []
            for i in range(numberOfPoints):
                x = getattr(displacementResult, 'STEP_{}'.format(step))[i,0]
                y = getattr(displacementResult, 'STEP_{}'.format(step))[i,1]
                z = getattr(displacementResult, 'STEP_{}'.format(step))[i,2]
                displacement.append(rg.Vector3d(x,y,z))
            
            
            rotationResult = Hdf5.ReadObject[Steps](fileId, "/MODEL_STAGE[1]/RESULTS/ON_NODES/ROTATION/DATA")
            rotation = []
            for i in range(numberOfPoints):
                x = getattr(rotationResult, 'STEP_{}'.format(step))[i,0]
                y = getattr(rotationResult, 'STEP_{}'.format(step))[i,1]
                z = getattr(rotationResult, 'STEP_{}'.format(step))[i,2]
                rotation.append(rg.Vector3d(x,y,z))
                
                
            Hdf5.CloseFile(fileId)
            print("I have closed the file")
        except:
            if fileId >0:
                Hdf5.CloseFile(fileId)
                print("I have closed the file because of exception")
    
    
    
    if History:
        try:
            fileId = Hdf5.OpenFile(AlpacaModel.recorderName, True)
            
            displacementResult = Hdf5.ReadObject[Steps](fileId, "/MODEL_STAGE[1]/RESULTS/ON_NODES/DISPLACEMENT/DATA")
            displacement = []
            
            for i in range(numberOfPoints):
                dispTemp = []
                maxNumberStep = int(AlpacaModel.analysis.NumberOfSteps)
                for n_step in range(maxNumberStep):
                    x = getattr(displacementResult, 'STEP_{}'.format(n_step))[i,0]
                    y = getattr(displacementResult, 'STEP_{}'.format(n_step))[i,1]
                    z = getattr(displacementResult, 'STEP_{}'.format(n_step))[i,2]
                    dispTemp.append(rg.Vector3d(x,y,z))
                    
                
                displacement.append(dispTemp)
    
    
    
    
            rotationResult = Hdf5.ReadObject[Steps](fileId, "/MODEL_STAGE[1]/RESULTS/ON_NODES/ROTATION/DATA")
            
            rotation = []
            
            for i in range(numberOfPoints):
                rotationTemp = []
                for n_step in range(maxNumberStep):
                    x = getattr(rotationResult, 'STEP_{}'.format(n_step))[i,0]
                    y = getattr(rotationResult, 'STEP_{}'.format(n_step))[i,1]
                    z = getattr(rotationResult, 'STEP_{}'.format(n_step))[i,2]
                    rotationTemp.append(rg.Vector3d(x,y,z))
                
                rotation.append(rotationTemp)
                
            Hdf5.CloseFile(fileId)
        except:
            Hdf5.CloseFile(fileId)
    
    
    displacement = th.list_to_tree(displacement)
    rotation = th.list_to_tree(rotation)
# ---------- end nd ----------
graph_2 = QuickGraph(nd.displacement, SortOrder=0)
panel_4 = Panel(rf.ReactionForce)

pt_3 = Point(rf.SupportPosition)
vec_2 = Vector(rf.ReactionMoment)
amp = Amplitude(Vector=vec_2, Amplitude=1)
vdisex = VectorDisplayEx(Point=pt_3, Vector=amp, Colour=ColourSwatch(SwatchColor=RGB(0, 128, 201)), Width=Slider(4, range=1..5))

pt_4 = Point(rf.SupportPosition)
vec_3 = Vector(rf.ReactionForce)
amp_2 = Amplitude(Vector=vec_3, Amplitude=1)
vdisex_2 = VectorDisplayEx(Point=pt_4, Vector=amp_2, Colour=ColourSwatch(SwatchColor=RGB(201, 0, 0)), Width=Slider(4, range=1..5))

merge = Merge(
    Data1=ColourSwatch(SwatchColor=RGB(122, 0, 0)),
    Data2=ColourSwatch(SwatchColor=RGB(247, 5, 5)),
    Data3=ColourSwatch(SwatchColor=RGB(255, 51, 0)),
    Data4=ColourSwatch(SwatchColor=RGB(255, 89, 0)),
    Data5=ColourSwatch(SwatchColor=RGB(255, 183, 0)),
    Data6=ColourSwatch(SwatchColor=RGB(208, 255, 0)),
    Data7=ColourSwatch(SwatchColor=RGB(0, 255, 17)),
    Data8=ColourSwatch(SwatchColor=RGB(0, 255, 111)),
    Data9=ColourSwatch(SwatchColor=RGB(0, 217, 255)),
    Data10=ColourSwatch(SwatchColor=RGB(0, 105, 217)),
    Data11=ColourSwatch(SwatchColor=RGB(6, 0, 71)))  # -> reverse(flatten(Result))
gradientlibrary = GradientLibrary(gradIndex=Slider(1, range=1..12))  # -> colors; inputs gradIndex: Int32
#   port colors: A series of colors to be plugged into the "Ladybug_Legend Parameters" component.
# ---------- gradientlibrary: Python ----------
"""
Preset of gradient colors perfect for Data Visualisation
    Inputs:
        gradIndex: An index refering to one of the following possible gradients:
            0 - Orignal Ladybug
            1 - Nuanced Ladybug
            2 - Multi-colored Ladybug
            3 - Ecotect
            4 - Thermal Comfort Percentage
            5 - Thermal Comfort Colors
            6 - Shade Benefit/Harm
            7 - Shade Harm
            8 - Shade Benefit
            9 - CFD Colors 1
            10 - Radiation Benefit
            11 - Gsa10 Colour
            12 - Gsa9 Colour
    Returns:
        customColors: A series of colors.
"""

ghenv.Component.Name = "Gradient Library"
ghenv.Component.NickName = 'GradientLibrary'
#ghenv.Component.Message = 'GradientLibrary\nWIP'

import scriptcontext as sc
import Grasshopper.Kernel as gh
import System

gradientLibrary = {
        0: [System.Drawing.Color.FromArgb(75, 107, 169), System.Drawing.Color.FromArgb(115, 147, 202), System.Drawing.Color.FromArgb(170, 200, 247), System.Drawing.Color.FromArgb(193, 213, 208), System.Drawing.Color.FromArgb(245, 239, 103), System.Drawing.Color.FromArgb(252, 230, 74), System.Drawing.Color.FromArgb(239, 156, 21), System.Drawing.Color.FromArgb(234, 123, 0), System.Drawing.Color.FromArgb(234, 74, 0), System.Drawing.Color.FromArgb(234, 38, 0)],
        1: [System.Drawing.Color.FromArgb(49,54,149), System.Drawing.Color.FromArgb(69,117,180), System.Drawing.Color.FromArgb(116,173,209), System.Drawing.Color.FromArgb(171,217,233), System.Drawing.Color.FromArgb(224,243,248), System.Drawing.Color.FromArgb(255,255,191), System.Drawing.Color.FromArgb(254,224,144), System.Drawing.Color.FromArgb(253,174,97), System.Drawing.Color.FromArgb(244,109,67), System.Drawing.Color.FromArgb(215,48,39), System.Drawing.Color.FromArgb(165,0,38)],
        2: [System.Drawing.Color.FromArgb(4,25,145), System.Drawing.Color.FromArgb(7,48,224), System.Drawing.Color.FromArgb(7,88,255), System.Drawing.Color.FromArgb(1,232,255), System.Drawing.Color.FromArgb(97,246,156), System.Drawing.Color.FromArgb(166,249,86), System.Drawing.Color.FromArgb(254,244,1), System.Drawing.Color.FromArgb(255,121,0), System.Drawing.Color.FromArgb(239,39,0), System.Drawing.Color.FromArgb(138,17,0)],
        3: [System.Drawing.Color.FromArgb(0,0,255), System.Drawing.Color.FromArgb(53,0,202), System.Drawing.Color.FromArgb(107,0,148), System.Drawing.Color.FromArgb(160,0,95), System.Drawing.Color.FromArgb(214,0,41), System.Drawing.Color.FromArgb(255,12,0), System.Drawing.Color.FromArgb(255,66,0), System.Drawing.Color.FromArgb(255,119,0), System.Drawing.Color.FromArgb(255,173,0), System.Drawing.Color.FromArgb(255,226,0), System.Drawing.Color.FromArgb(255,255,0)],
        4: [System.Drawing.Color.FromArgb(0,0,0), System.Drawing.Color.FromArgb(110,0,153), System.Drawing.Color.FromArgb(255,0,0), System.Drawing.Color.FromArgb(255,255,102), System.Drawing.Color.FromArgb(255,255,255)],
        5: [System.Drawing.Color.FromArgb(0,136,255), System.Drawing.Color.FromArgb(200,225,255), System.Drawing.Color.FromArgb(255,255,255), System.Drawing.Color.FromArgb(255,230,230), System.Drawing.Color.FromArgb(255,0,0)],
        6: [System.Drawing.Color.FromArgb(5,48,97), System.Drawing.Color.FromArgb(33,102,172), System.Drawing.Color.FromArgb(67,147,195), System.Drawing.Color.FromArgb(146,197,222), System.Drawing.Color.FromArgb(209,229,240), System.Drawing.Color.FromArgb(255,255,255), System.Drawing.Color.FromArgb(253,219,199), System.Drawing.Color.FromArgb(244,165,130), System.Drawing.Color.FromArgb(214,96,77), System.Drawing.Color.FromArgb(178,24,43), System.Drawing.Color.FromArgb(103,0,31)],
        7: [System.Drawing.Color.FromArgb(255,255,255), System.Drawing.Color.FromArgb(253,219,199), System.Drawing.Color.FromArgb(244,165,130), System.Drawing.Color.FromArgb(214,96,77), System.Drawing.Color.FromArgb(178,24,43), System.Drawing.Color.FromArgb(103,0,31)],
        8: [System.Drawing.Color.FromArgb(255,255,255), System.Drawing.Color.FromArgb(209,229,240), System.Drawing.Color.FromArgb(146,197,222), System.Drawing.Color.FromArgb(67,147,195), System.Drawing.Color.FromArgb(33,102,172), System.Drawing.Color.FromArgb(5,48,97)],
        9: [System.Drawing.Color.FromArgb(0,16,120), System.Drawing.Color.FromArgb(38,70,160), System.Drawing.Color.FromArgb(5,180,222), System.Drawing.Color.FromArgb(16,180,109), System.Drawing.Color.FromArgb(59,183,35), System.Drawing.Color.FromArgb(143,209,19), System.Drawing.Color.FromArgb(228,215,29), System.Drawing.Color.FromArgb(246,147,17), System.Drawing.Color.FromArgb(243,74,0), System.Drawing.Color.FromArgb(255,0,0)],
        10: [System.Drawing.Color.FromArgb(0,191,48), System.Drawing.Color.FromArgb(255,238,184), System.Drawing.Color.FromArgb(255,0,0)],
        11: [System.Drawing.Color.FromArgb(204,0,71), System.Drawing.Color.FromArgb(255,182,71), System.Drawing.Color.FromArgb(206,255,115), System.Drawing.Color.FromArgb(26,180, 214),System.Drawing.Color.FromArgb(0,0,207)],
        12: [System.Drawing.Color.FromArgb(255, 51, 51), System.Drawing.Color.FromArgb(255, 170, 51), System.Drawing.Color.FromArgb(255, 255, 51), System.Drawing.Color.FromArgb(170, 255, 125), System.Drawing.Color.FromArgb(51, 255, 231), System.Drawing.Color.FromArgb(51, 170, 255), System.Drawing.Color.FromArgb(51,51, 255)]}
colors = gradientLibrary[gradIndex]
# ---------- end gradientlibrary ----------

# ---- group: Vector Deformed Point
python_12 = GhPythonScript(
    AlpacaModel=ra.AlpacaSolvedModel,
    step=Slider(0, range=0..9),
    amplitude=Slider(0.0006, range=0..0.01),
    extrudeModel=Toggle(False),
    typeColor=Slider(2, range=0..10),
    listColor=gradientlibrary)  # -> DefModel, bound; inputs step: Int32, extrudeModel: Boolean, typeColor: Int32, listColor: list of Color
# ---------- python_12: Python ----------
from ghpythonlib.componentbase import executingcomponent as component
import System
import rhinoscriptsyntax as rs

import sys
import os
import clr
import clrtype
import Rhino.Geometry as rg
import Rhino as rc
import math as mt
import Grasshopper as gh
import ghpythonlib.treehelpers as th

from Alpaca4d import alpaca4dView as alpacaView
FolderPath = rs.DocumentPath()
os.chdir(FolderPath)

ghcompfolder = gh.Folders.DefaultAssemblyFolder
my_module_name = "Alpaca_StepReader" # replace this with something unique that doesn't collide with a real module!
my_module = sys.modules.setdefault(my_module_name, type(sys)(my_module_name))

hdfFilePath = os.path.join(ghcompfolder, "Alpaca4d\HDF5CSharp.dll")
clr.AddReferenceToFileAndPath(hdfFilePath)


from HDF5CSharp import Hdf5

class MyComponent(component):
    
    def RunScript(self, AlpacaModel, step, amplitude, extrudeModel, typeColor, listColor):
        self.AlpacaModel = AlpacaModel
        self.step = step
        self.amplitude = amplitude
        self.extrudeModel = extrudeModel
        self.typeColor = typeColor
        self.listColor = listColor

        try:
            Steps = my_module.Steps
        except AttributeError:
            type_2d = type(System.Array.CreateInstance(float, 1, 1))
                
            class Steps(object):
                __metaclass__ = clrtype.ClrClass
                _clrfields = {"STEP_{}".format(i): type_2d for i in range(1000)} # it will work for model with less than 1000 steps
                
            my_module.Steps = Steps
        #print(outputFolder)
                
        fileId = Hdf5.OpenFile(self.AlpacaModel.recorderName, True)
        numberOfPoints = len(self.AlpacaModel.uniquePoints) #
                
                
        displacementResult = Hdf5.ReadObject[Steps](fileId, "/MODEL_STAGE[1]/RESULTS/ON_NODES/DISPLACEMENT/DATA")
                
        displacement = []
        rotation = []
        dispNodeList = []
        for i in range(numberOfPoints):
            tag = i + 1
            vx = getattr(displacementResult, 'STEP_{}'.format(self.step))[i,0]
            vy = getattr(displacementResult, 'STEP_{}'.format(self.step))[i,1]
            vz = getattr(displacementResult, 'STEP_{}'.format(self.step))[i,2]
            trasl = rg.Vector3d(vx,vy,vz)
            displacement.append(trasl)
            dispNodeList.append( [tag, trasl] )
            
        Hdf5.CloseFile(fileId)
        dispNodeDict = dict( dispNodeList )
        #---------------------------------------------------#
        def ColorBeamDef( BeamDef, defEleVector, bounds, ListColor, type):
            #tDomain = ghcomp.ConstructDomain( -1, 1 ) #[-1,1]
            t1 = abs(bounds[0])
            t2 = abs(bounds[1])
            modelBeamDef = []
            colorBeam = []
            for ele, vector in zip(BeamDef,defEleVector):
                n = 2 #len(defEleVector)
                divide = ele.DivideByCount( n, True )
                segmentCurve = rg.Curve.Split(ele, divide)
                modelBeamDef.append( segmentCurve )
                listColor = []
                for ivector in vector:
                    if type == 0:
                        valor = ivector.X
                    elif type == 1:
                        valor = ivector.Y
                    elif type == 2:
                        valor = ivector.Z
                    elif type == 3:
                        valor = ivector.SquareLength #ivector.Length
                    Valor = (valor + t1)/(t1+t2)
                    #color = ghcomp.Interpolatedata( ListColor, Valor)
                    #color = rs.CreateColor( 255, 255, 0 )
                    color = alpacaView.sampleColor( ListColor, Valor )
                    listColor.append( color )
                colorBeam.append( listColor )
                
            return modelBeamDef, colorBeam
    
        #defModel = ShellDef(AlpacaModel,dispNodeDict).defEle(c) 
        defEleVector1 = alpacaView.BeamVectorDef(AlpacaModel,dispNodeDict) #beam
        defEleVector2 = alpacaView.ShellVectorDef(AlpacaModel,dispNodeDict) #shell
        bound = alpacaView.boundsDef(displacement, typeColor)
        if self.extrudeModel is None or self.extrudeModel is False:
            #BEAM
            defModel1 = alpacaView.BeamDef(AlpacaModel, dispNodeDict,amplitude)
            self.defModel1, self.beamColor = ColorBeamDef( defModel1, defEleVector1, bound, listColor, typeColor)
            #SHELL
            defModel2 = alpacaView.ShellDef(AlpacaModel,dispNodeDict,amplitude)
        else:
            #BEAM
            defModel1 = alpacaView.BeamDefExtrude(AlpacaModel, dispNodeDict,amplitude)
            self.defModel1 = alpacaView.ColorBeamDefExtrude( defModel1, defEleVector1, bound, listColor, typeColor)
            #SHELL
            defModel2 = alpacaView.ShellDefExtrude(AlpacaModel,dispNodeDict,amplitude)
        
        #SHELL COLOR
        self.defModel2 = alpacaView.ColorShellDef( defModel2, defEleVector2 , bound, listColor, typeColor, extrudeModel )
        
        DefModel = th.list_to_tree(self.defModel1 + defModel2)
        
        
        # return outputs if you have them; here I try it for you:
        return (DefModel, bound)
        
    def DrawViewportWires(self,arg):
        for iMesh in self.defModel2 :
            colorWirframe = System.Drawing.Color.Black
            arg.Display.DrawMeshWires(iMesh, colorWirframe)
            
        if self.extrudeModel is None or self.extrudeModel is False:
            thickness =2
            for iBeam, iColor in zip(self.defModel1, self.beamColor) :
                for jBeam, jColor in zip(iBeam, iColor):
                    arg.Display.DrawCurve(jBeam, jColor, thickness)
            
        else:
            for iBeam in self.defModel1 :
                colorWirframe = System.Drawing.Color.Black
                arg.Display.DrawMeshWires(iBeam, colorWirframe)
# ---------- end python_12 ----------

# ----
# Trigonometric Time Series
python_13 = GhPythonScript(tStart=Slider(0, range=0..5), tEnd="10.00", period="3.00")  # -> timeSeries, Graph
# ---------- python_13: Python ----------
"""
Create a PointLoad
-
    Args:
        tStart:
        tEnd:
        period:
        factor:
        shift:
    Returns:
        timeSeries:
        Graph:
"""

import sys
import Rhino.Geometry as rg
import Grasshopper as gh
import copy
import math


## add alpaca install directory to system path

ghcompfolder = gh.Folders.DefaultAssemblyFolder
if ghcompfolder not in sys.path:
    sys.path.append(ghcompfolder)

try:
    from Alpaca4d import alpaca4d as alpaca
except:
    msg = "Cannot import Alpaca4d. Is the Alpaca4d folder available in " + ghcompfolder + "?"
    ghenv.Component.AddRuntimeMessage(gh.Kernel.GH_RuntimeMessageLevel.Error, msg)


def TrigonometricSeries(tStart, tEnd, period, shift, factor,t):
    if tStart <= t and t < tEnd:
        x = factor * math.sin( (2.0 * math.pi * (t - tStart))/period + shift)
        return x
    else:
        return 0

def linspace(a, b, n):
    if n < 2:
        return None
    diff = (float(b) - a)/(n - 1)
    return [diff * i + a  for i in range(n)]



checkData = True

if not tStart and not tStart == 0:
    checkData = False
    msg = "Input parameter tStart failed to collect data"
    ghenv.Component.AddRuntimeMessage(gh.Kernel.GH_RuntimeMessageLevel.Warning, msg)

if not tEnd and not tEnd == 0:
    checkData = False
    msg = "Input parameter tEnd failed to collect data"
    ghenv.Component.AddRuntimeMessage(gh.Kernel.GH_RuntimeMessageLevel.Warning, msg)

if not period:
    checkData = False
    msg = "Input parameter period failed to collect data"
    ghenv.Component.AddRuntimeMessage(gh.Kernel.GH_RuntimeMessageLevel.Warning, msg)

if not factor:
    factor = 1

if not shift:
    shift = 0

if checkData:
    timeSeries = alpaca.TimeSeriesTrigonometric(tStart, tEnd, period, factor, shift)

    Graph = []
    
    for t in linspace(0,tEnd*2,100):
        Graph.append(TrigonometricSeries(tStart, tEnd, period, shift, factor,t))
# ---------- end python_13 ----------
panel_5 = Panel(python_13.timeSeries)

graph_3 = QuickGraph(python_13.Graph, SortOrder=0)

num = Number([-0.000450671, -0.000455154, -1.48413e-05, 0.000507632, 0.000437923, 0.000441503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])
lng = ListLength(List=num)
series_3 = Series(Start=0, Step="0.01", Count=lng)

# ----
# Path TimeSeries
number_slider_15 = Slider(7, range=1..10)
python_14 = GhPythonScript(time=series_3, values=num, factor=number_slider_15)  # -> out, timeSeries, Graph; inputs time: list, values: list
# ---------- python_14: Python ----------
"""
Create a Time Series Path
-
    Args:
        time:
        values:
        factor:
    Returns:
        timeSeries:
        Graph:
"""

import sys
import Rhino.Geometry as rg
import Grasshopper as gh
import copy


## add alpaca install directory to system path

ghcompfolder = gh.Folders.DefaultAssemblyFolder
if ghcompfolder not in sys.path:
    sys.path.append(ghcompfolder)

try:
    from Alpaca4d import alpaca4d as alpaca
except:
    msg = "Cannot import Alpaca4d. Is the Alpaca4d folder available in " + ghcompfolder + "?"
    ghenv.Component.AddRuntimeMessage(gh.Kernel.GH_RuntimeMessageLevel.Error, msg)


checkData = True

if not time:
    checkData = False
    msg = "Input parameter time failed to collect data"
    ghenv.Component.AddRuntimeMessage(gh.Kernel.GH_RuntimeMessageLevel.Warning, msg)

if not values:
    checkData = False
    msg = "Input parameter values failed to collect data"
    ghenv.Component.AddRuntimeMessage(gh.Kernel.GH_RuntimeMessageLevel.Warning, msg)

if not factor:
    factor = 1


if checkData:
    timeSeries = alpaca.TimeSeriesPath(values, time, factor)
    Graph = [value * factor for value in values]
# ---------- end python_14 ----------

graph_4 = QuickGraph(python_14.Graph, SortOrder=0)
