# Grasshopper definition 210421_Geometry Generator_FMT_MP_PlateSubdivededBy1.gh (Grasshopper 1.0.7)
# plug-ins: Human, EleFront, Weaverbird, Wallacei, Silvereye, karambaGH

sheet_curve = Curve([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])
genes = GenePool(Decimals=0, Maximum=1, Minimum=0, Value=[0, 0, 1, 0, 1, 1, 1, 0, 1, 0, 1, 0, 0, 0, 1, 1, 0, 1, 0, 1])
genes_2 = GenePool(Decimals=0, Maximum=1, Minimum=0, Value=[0, 0, 0, 0, 0, 0, 0, 0, 0, 0, 0, 1, 1, 1, 1, 0, 1, 0, 1, 1])
renameplz = Panel("""-0.08
0.08""")

# ----
# Panel Group
crv = Curve(sheet_curve)
area = Area(Geometry=crv)  # -> Area, Centroid
lng = ListLength(List=crv)
series = Series(Start=0, Step=1, Count=lng)
textdot = DefineTextDot(Text=series, Location=area.Centroid, Font="Arial", Size=14)

item = ListItem(List=renameplz, Index=genes_2, Wrap=True)
rec = Rectangle(sheet_curve)
area_2 = Area(Geometry=sheet_curve)  # -> Area, Centroid
explode = Explode(Curve=rec, Recursive=True)  # -> simplify(Segments), Vertices
len = Length(Curve=explode.Segments)
sort = SortList(Keys=len, ValuesA=explode.Segments)  # -> Keys, ValuesA
item_2 = ListItem(List=sort.ValuesA, Index=0, Wrap=True)  # -> Item, Item1
midpt = CurveMiddle(Curve=item_2.Item)
midpt_2 = CurveMiddle(Curve=item_2.Item1)
xy = XYPlane(Origin=area_2.Centroid)
pi = Pi(Factor=item)
vec2pt = Vector2Pt(PointA=midpt, PointB=midpt_2, Unitize=False)  # -> flatten(Vector), Length
align = AlignPlane(Plane=xy, Direction=vec2pt.Vector)  # -> Plane, Angle
prot = RotatePlane(Plane=align.Plane, Angle=pi)
deplane = DeconstructPlane(Plane=prot)  # -> Origin, XAxis, YAxis, ZAxis
rev = Reverse(Vector=deplane.XAxis)
graft = GraftTree(Tree=genes, IncludeEmptyLists=True, IncludeNullItems=True)
graft_2 = GraftTree(Tree=rev, IncludeEmptyLists=True, IncludeNullItems=True)
graft_3 = GraftTree(Tree=deplane.XAxis, IncludeEmptyLists=True, IncludeNullItems=True)
merge = Merge(Data1=graft_3, Data2=graft_2)
item_3 = ListItem(List=simplify(merge), Index=simplify(graft), Wrap=True)  # -> flatten(Item)
c_script = CSharpScript(
    centre=area_2.Centroid,
    direction=item_3,
    length=Slider(2.5, range=0..10),
    radius=Slider(0.33, range=0..1),
    widthTop=Slider(0.4, range=0..1),
    widthBottom=Slider(0.4, range=0..1))  # -> out, topCurve, centreLine, foldedLine, headHeight; inputs centre: Point3d, direction: Vector3d, length: Double, radius: Double, widthTop: Double, widthBottom: Double
# ---------- c_script: C# ----------
        //we want to work entirely within a set plane
        Plane cutPlane = Plane.WorldXY;
        cutPlane.Origin = centre;
        Vector3d yVector = new Vector3d(direction);
        yVector.Rotate(0.5 * Math.PI, cutPlane.ZAxis);

        cutPlane = new Plane(centre, direction, yVector);

        Point3d point1 = cutPlane.PointAt(-0.5 * length, 0.5 * widthTop);
        Point3d point2 = cutPlane.PointAt(-0.5 * length, -0.5 * widthTop);
        Point3d point3 = cutPlane.PointAt(0.5 * length, 0.5 * widthBottom);
        Point3d point4 = cutPlane.PointAt(0.5 * length, -0.5 * widthBottom);

        Polyline pLine = new Polyline() { point1, point3, point4, point2 };
        Curve filletCurve = Curve.CreateFilletCornersCurve(pLine.ToPolylineCurve(), widthBottom / 2, 0.01, 0.01);
        Line topLine = new Line(point1, point2);
        NurbsCurve topLineCurve = topLine.ToNurbsCurve();

        List<Curve> crvs = new List<Curve>() {filletCurve, topLineCurve};
        Curve[] joined = Curve.JoinCurves(crvs);
        topCurve = joined[0];

        Point3d c1 = 0.5 * (point1 + point2);
        Point3d c2 = 0.5 * (point3 + point4);
        centreLine = new Line(c1, c2).ToNurbsCurve();

        Plane arcPlane = new Plane(c1, direction, Vector3d.ZAxis);
        Arc radiusArc = new Arc(new Circle(arcPlane, radius), new Interval(0, 0.5 * Math.PI));
        radiusArc.Transform(Transform.Translation(new Vector3d(0, 0, -radius)));

        double remainingLineLength = length - radiusArc.Length;
        Point3d topPt = radiusArc.StartPoint;
        Point3d bottomPt = new Point3d(topPt.X, topPt.Y, topPt.Z - remainingLineLength);
        NurbsCurve foldedLinePartB = new Line(topPt, bottomPt).ToNurbsCurve();
        List<Curve> foldedLineCurves = new List<Curve>(){radiusArc.ToNurbsCurve(), foldedLinePartB};
        Curve[] joinedfoldedLine = Curve.JoinCurves(foldedLineCurves);
        Curve foldedLineComplete = joinedfoldedLine[0];
        foldedLineComplete.Domain = new Interval(0.0, 1.0);
        foldedLineComplete.Reverse();
        foldedLine = foldedLineComplete;
        headHeight = remainingLineLength + radius;
# ---------- end c_script ----------
boundary = BoundarySurfaces(Edges=sheet_curve)  # -> simplify(graft(Surfaces))
srfsplit = SurfaceSplit(Surface=boundary, Curves=simplify(graft(c_script.topCurve)))
boundary_2 = BoundarySurfaces(Edges=c_script.topCurve)
end = EndPoints(Curve=c_script.foldedLine)  # -> Start, End
item_4 = ListItem(List=srfsplit, Index=0, Wrap=True)  # -> flatten(Item)
flow = Flow(
    Geometry=boundary_2,
    Base=c_script.centreLine,
    Target=c_script.foldedLine,
    ReverseBase=False,
    ReverseTarget=False,
    Stretch=True,
    Rigid=False)
item_5 = ListItem(List=c_script.headHeight, Index=0, Wrap=True)
Z = UnitZ(Factor=item_5)
merge_2 = Merge(Data1=flatten(item_4), Data2=flatten(flow))
move = Move(Geometry=merge_2, Motion=Z)  # -> Geometry, Transform
move_2 = Move(Geometry=end.End, Motion=Z)  # -> Geometry, Transform
join = BrepJoin(Breps=move.Geometry)  # -> Breps, Closed
mesh_breps = MeshBrepsKaramba3D(
    Brep=join.Breps,
    InclusionPoints=move_2.Geometry,
    MeshResolution=Slider(0.1, range=0..1),
    EdgeRefinementFactor=0.67,
    PointReduction=False,
    SmoothingStepSize=0,
    SmoothingIterations=5)  # -> Mesh, Info
matselect = MaterialSelectionKaramba3D(menu=[dropdown(5), dropdown(2)])
mesh = Mesh(mesh_breps.Mesh)
cross_section = CrossSectionKaramba3D(FamilyNameOfCrossSection="DefaultCroSec", Material=matselect, Height_cm=Slider(2, range=0..10), mode="Shell - Const")
meshtoshell = MeshToShellKaramba3D(Mesh=mesh, CrossSection=cross_section, LimitDistance_m=0.005)  # -> Element, Points, Info
lng_2 = ListLength(List=sheet_curve)
split = SplitList(List=mesh_breps.Mesh, Index=lng_2)  # -> ListA, ListB
neg = Negative(Value="0.25")
pt = Point(move_2.Geometry)
Z_2 = UnitZ(Factor=neg)
geo = Geometry(split.ListA)
supp = SupportKaramba3D(PosInd=pt, menu=[buttons(on, on, on, off, off, off)])
loads = LoadsKaramba3D(Vector=Vector(0, 0, -1), mode="Gravity")
loads_2 = LoadsKaramba3D(Vector=Z_2, Mesh=geo, LCase=0, mode="MeshLoad -Const.", menu=[buttons(off, on, off), buttons(on, off)])
load = LoadKaramba3D(flatten(loads))
assemble = AssembleModelKaramba3D(Elem=meshtoshell.Element, Support=supp, Load=load, LimitDistance_m=0.005)  # -> Model, Info, Mass_kg, CenterOfGravity
analyze = AnalyzeKaramba3D(Model=assemble.Model)  # -> CalculatedModel, MaximumDisplacement_cm, ResultingForceOfGravity_kN, ElasticEnergy_kNm
gh_silvereye = Silvereye(SilvereyeData_fitness_fcn=wlc_displacement, SilvereyeData_parameter=[genes_2, genes])
gradientlibrary = GradientLibrary(gradIndex=Slider(2, range=0..12))  # -> colors; inputs gradIndex: Int32
#   port colors: A series of colors to be plugged into the "Ladybug_Legend Parameters" component.
# ---------- gradientlibrary: Python ----------
"""
Preset of gradient colors perfect for Data Visualisation
    Inputs:
        gradIndex: An index refering to one of the following possible gradients:
            0 - Orignal Ladybug
            1 - Nuanced Ladybug
            2 - Multi-colored Ladybug
            3 - Ecotect
            4 - Thermal Comfort Percentage
            5 - Thermal Comfort Colors
            6 - Shade Benefit/Harm
            7 - Shade Harm
            8 - Shade Benefit
            9 - CFD Colors 1
            10 - Radiation Benefit
            11 - Gsa10 Colour
            12 - Gsa9 Colour
    Returns:
        customColors: A series of colors.
"""

ghenv.Component.Name = "Gradient Library"
ghenv.Component.NickName = 'GradientLibrary'
#ghenv.Component.Message = 'GradientLibrary\nWIP'

import scriptcontext as sc
import Grasshopper.Kernel as gh
import System

gradientLibrary = {
        0: [System.Drawing.Color.FromArgb(75, 107, 169), System.Drawing.Color.FromArgb(115, 147, 202), System.Drawing.Color.FromArgb(170, 200, 247), System.Drawing.Color.FromArgb(193, 213, 208), System.Drawing.Color.FromArgb(245, 239, 103), System.Drawing.Color.FromArgb(252, 230, 74), System.Drawing.Color.FromArgb(239, 156, 21), System.Drawing.Color.FromArgb(234, 123, 0), System.Drawing.Color.FromArgb(234, 74, 0), System.Drawing.Color.FromArgb(234, 38, 0)],
        1: [System.Drawing.Color.FromArgb(49,54,149), System.Drawing.Color.FromArgb(69,117,180), System.Drawing.Color.FromArgb(116,173,209), System.Drawing.Color.FromArgb(171,217,233), System.Drawing.Color.FromArgb(224,243,248), System.Drawing.Color.FromArgb(255,255,191), System.Drawing.Color.FromArgb(254,224,144), System.Drawing.Color.FromArgb(253,174,97), System.Drawing.Color.FromArgb(244,109,67), System.Drawing.Color.FromArgb(215,48,39), System.Drawing.Color.FromArgb(165,0,38)],
        2: [System.Drawing.Color.FromArgb(4,25,145), System.Drawing.Color.FromArgb(7,48,224), System.Drawing.Color.FromArgb(7,88,255), System.Drawing.Color.FromArgb(1,232,255), System.Drawing.Color.FromArgb(97,246,156), System.Drawing.Color.FromArgb(166,249,86), System.Drawing.Color.FromArgb(254,244,1), System.Drawing.Color.FromArgb(255,121,0), System.Drawing.Color.FromArgb(239,39,0), System.Drawing.Color.FromArgb(138,17,0)],
        3: [System.Drawing.Color.FromArgb(0,0,255), System.Drawing.Color.FromArgb(53,0,202), System.Drawing.Color.FromArgb(107,0,148), System.Drawing.Color.FromArgb(160,0,95), System.Drawing.Color.FromArgb(214,0,41), System.Drawing.Color.FromArgb(255,12,0), System.Drawing.Color.FromArgb(255,66,0), System.Drawing.Color.FromArgb(255,119,0), System.Drawing.Color.FromArgb(255,173,0), System.Drawing.Color.FromArgb(255,226,0), System.Drawing.Color.FromArgb(255,255,0)],
        4: [System.Drawing.Color.FromArgb(0,0,0), System.Drawing.Color.FromArgb(110,0,153), System.Drawing.Color.FromArgb(255,0,0), System.Drawing.Color.FromArgb(255,255,102), System.Drawing.Color.FromArgb(255,255,255)],
        5: [System.Drawing.Color.FromArgb(0,136,255), System.Drawing.Color.FromArgb(200,225,255), System.Drawing.Color.FromArgb(255,255,255), System.Drawing.Color.FromArgb(255,230,230), System.Drawing.Color.FromArgb(255,0,0)],
        6: [System.Drawing.Color.FromArgb(5,48,97), System.Drawing.Color.FromArgb(33,102,172), System.Drawing.Color.FromArgb(67,147,195), System.Drawing.Color.FromArgb(146,197,222), System.Drawing.Color.FromArgb(209,229,240), System.Drawing.Color.FromArgb(255,255,255), System.Drawing.Color.FromArgb(253,219,199), System.Drawing.Color.FromArgb(244,165,130), System.Drawing.Color.FromArgb(214,96,77), System.Drawing.Color.FromArgb(178,24,43), System.Drawing.Color.FromArgb(103,0,31)],
        7: [System.Drawing.Color.FromArgb(255,255,255), System.Drawing.Color.FromArgb(253,219,199), System.Drawing.Color.FromArgb(244,165,130), System.Drawing.Color.FromArgb(214,96,77), System.Drawing.Color.FromArgb(178,24,43), System.Drawing.Color.FromArgb(103,0,31)],
        8: [System.Drawing.Color.FromArgb(255,255,255), System.Drawing.Color.FromArgb(209,229,240), System.Drawing.Color.FromArgb(146,197,222), System.Drawing.Color.FromArgb(67,147,195), System.Drawing.Color.FromArgb(33,102,172), System.Drawing.Color.FromArgb(5,48,97)],
        9: [System.Drawing.Color.FromArgb(0,16,120), System.Drawing.Color.FromArgb(38,70,160), System.Drawing.Color.FromArgb(5,180,222), System.Drawing.Color.FromArgb(16,180,109), System.Drawing.Color.FromArgb(59,183,35), System.Drawing.Color.FromArgb(143,209,19), System.Drawing.Color.FromArgb(228,215,29), System.Drawing.Color.FromArgb(246,147,17), System.Drawing.Color.FromArgb(243,74,0), System.Drawing.Color.FromArgb(255,0,0)],
        10: [System.Drawing.Color.FromArgb(0,191,48), System.Drawing.Color.FromArgb(255,238,184), System.Drawing.Color.FromArgb(255,0,0)],
        11: [System.Drawing.Color.FromArgb(204,0,71), System.Drawing.Color.FromArgb(255,182,71), System.Drawing.Color.FromArgb(206,255,115), System.Drawing.Color.FromArgb(26,180, 214),System.Drawing.Color.FromArgb(0,0,207)],
        12: [System.Drawing.Color.FromArgb(255, 51, 51), System.Drawing.Color.FromArgb(255, 170, 51), System.Drawing.Color.FromArgb(255, 255, 51), System.Drawing.Color.FromArgb(170, 255, 125), System.Drawing.Color.FromArgb(51, 255, 231), System.Drawing.Color.FromArgb(51, 170, 255), System.Drawing.Color.FromArgb(51,51, 255)]}
colors = gradientLibrary[gradIndex]
# ---------- end gradientlibrary ----------
nodedisp = NodalDisplacementsKaramba3D(AnalyzedModel=analyze.CalculatedModel, ResultCase=0)  # -> AnalyzedModel, NodalTranslations_m, NodalRotations_rad
utilization = UtilizationOfElementsKaramba3D(AnalyzedModel=analyze.CalculatedModel, ResultCase=-1, mode="Shells")  # -> AnalyzedModel, flatten(Utilization)
analyzethii = AnalyzeThIIKaramba3D(Model=analyze.CalculatedModel, LoadCase=-1, RTolerance=1e-07, MaxIterations=50, NoTensionalNII=False)  # -> CalculatedModel, MaximumDisplacement_cm, ResultingForceOfGravity_kN, ElasticEnergy_kNm
devec = DeconstructVector(Vector=nodedisp.NodalTranslations_m)  # -> XComponent, YComponent, ZComponent; disabled
vlen = VectorLength(Vector=nodedisp.NodalTranslations_m)
bmodes = BucklingModesKaramba3D(Model=analyzethii.CalculatedModel, FromIndex=1, NumberOfModes=1, MaximumNumberOfIterations=300, Epsilon=1e-07)  # -> ModelWithBucklingModesAsLoadCaseResults, BucklingLoadFactors
modelview = ModelViewKaramba3D(Model=analyze.CalculatedModel, ResultFactors=1, ResultCase=-1, Colors=gradientlibrary)  # -> Model, DeformedMesh, DeformedAxes, DeformedModel
abs = Absolute(Value=devec.XComponent)  # disabled
abs_2 = Absolute(Value=devec.YComponent)  # disabled
abs_3 = Absolute(Value=devec.ZComponent)  # disabled
sort_2 = SortList(Keys=abs_2)  # -> Keys, ValuesA; disabled
sort_3 = SortList(Keys=abs_3)  # -> Keys, ValuesA; disabled
sort_4 = SortList(Keys=vlen)  # -> Keys, ValuesA
sort_5 = SortList(Keys=utilization.Utilization)  # -> Keys, ValuesA
sort_6 = SortList(Keys=abs)  # -> Keys, ValuesA; disabled
num = Number(expr("Round(x,1)", bmodes.BucklingLoadFactors))
item_6 = ListItem(List=reverse(sort_2.Keys), Index=0, Wrap=True)  # disabled
item_7 = ListItem(List=reverse(sort_3.Keys), Index=0, Wrap=True)  # disabled
item_8 = ListItem(List=reverse(sort_4.Keys), Index=0, Wrap=True)
item_9 = ListItem(List=reverse(sort_6.Keys), Index=0, Wrap=True)  # disabled
item_10 = ListItem(List=reverse(sort_5.Keys), Index=0, Wrap=True)
shellview = ShellViewKaramba3D(Model=modelview.Model, IndexOfLayer=0)  # -> Model, MeshesOfRenderedShells, LegendColors, LegendTags

col = Colour(gradientlibrary)
num_2 = Number(expr("Round(x*1000,0)", vlen))
bnd = Bounds(Numbers=flatten(num_2))

one_over_x = OneOverX(Value=num)
wlc_displacement = Number(expr("Round(x*1000,1)", item_8))
wlc_displacement_x = Number(expr("Round(x*1000,1)", item_9))  # disabled
wlc_displacement_y = Number(expr("Round(x*1000,1)", item_6))  # disabled
wlc_displacement_z = Number(expr("Round(x*1000,1)", item_7))  # disabled
wlc_utilisation = Number(expr("Round(x*100,1)", item_10))
wlc_buckling = Number(one_over_x)
mjoin = MeshJoin(Meshes=shellview.MeshesOfRenderedShells)
wbnaked = WeaverbirdsNakedBoundary(MeshClosedPolylines=mesh)

# ---- group: Performance parameters
header = Panel("""displacement DL+WIND: 
Utilisation: 
Buckling Factor: """)
entwine = Entwine(Branch00=wlc_displacement, Branch01=wlc_utilisation, Branch02=num, FlattenInputs=True)  # -> flatten(Result)
units = Panel(""" mm
 %
 """)
concat = Concatenate(FragmentA=header, FragmentB=entwine, FragmentC=units)
txt = Text(concat)
panel = Panel(txt)
lng_3 = ListLength(List=txt)
series_2 = Series(Start=Slider(87, range=0..100), Step=Slider(30, range=0..100), Count=lng_3)
pt_2 = ConstructPoint(XCoordinate=Slider(63, range=0..1000), YCoordinate=series_2, ZCoordinate=0)
texttoscreen = RenderTextToScreen(
    Text=txt,
    Location=pt_2,
    Size=Slider(15, range=0..100),
    Color=ColourSwatch(SwatchColor=RGB(0, 0, 0)),
    Font="Inconsolata",
    m_scWithvp=False)

# ----
wbnaked_2 = WeaverbirdsNakedBoundary(MeshClosedPolylines=mjoin)
dash = DashPattern(Curve=wbnaked, Pattern="0.20")  # -> Dashes, Gaps
wallacei_x = WallaceiX(
    Genes=[genes_2, genes],
    Objectives=flatten([wlc_displacement, wlc_utilisation, wlc_buckling]),
    Phenotype=mjoin,
    allFitness="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",
    allFrontIdx="4|5;5|2;6|5;6|7;7|5;7|6;7|7;7|9;7|10;8|11;8|12;8|13;8|14;8|15;8|16;9|0;9|3;9|4;9|6;9|10;9|11;9|12;9|13",
    allGenomes="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",
    curFrontIdx="9|0;9|1;9|2;9|3;9|4;9|5;9|6;9|7;9|8;9|9;9|10;9|11;9|12;9|13;9|14;9|15;9|16;9|17;9|18;9|19",
    curFrontIdxSave="0|1;0|14;0|16;0|17;1|0;1|1;1|2;1|3;1|4;2|0;2|1;2|2;2|3;2|4;2|5;2|6;3|0;3|1;3|2;3|3;3|4;3|5;3|6;3|7;4|0;4|1;4|2;4|3;4|4;4|5;4|6;4|7;5|0;5|1;5|2;5|3;5|4;6|0;6|1;6|2;6|3;6|4;6|5;6|6;6|7;7|0;7|1;7|2;7|3;7|4;7|5;7|6;7|7;7|8;7|9;7|10;8|0;8|1;8|2;8|3;8|4;8|5;8|6;8|7;8|8;8|9;8|10;8|11;8|12;8|13;8|14;8|15;8|16;9|0;9|1;9|2;9|3;9|4;9|5;9|6;9|7;9|8;9|9;9|10;9|11;9|12;9|13;9|14;9|15;9|16;9|17;9|18;9|19",
    popGen="20,10",
    total="1822922",
    wlcDone=True)  # -> WallaceiGenomes, FitnessValues, Data, WPhenotypes; disabled

mjoin_2 = MeshJoin(Meshes=shellview.MeshesOfRenderedShells)
cluster = Cluster(col=col, C=ColourSwatch(SwatchColor=RGB(0, 0, 0)), D=bnd, X=Slider(1416, range=0..2000), Y=Slider(1332, range=0..2000))
previewlw = CustomPreviewLineweights(Geometry=dash.Dashes, Shader=ColourSwatch(SwatchColor=RGB(84, 84, 84)), Thickness="2", Absolute=False)
previewlw_2 = CustomPreviewLineweights(Geometry=wbnaked_2, Shader=ColourSwatch(SwatchColor=RGB(0, 0, 0)), Absolute=False)

panel_2 = Panel("5")  # disabled
item_11 = ListItem(List=wallacei_x.FitnessValues, Index=0, Wrap=True)  # disabled
item_12 = ListItem(List=wallacei_x.FitnessValues, Index=panel_2, Wrap=True)  # disabled
bnd_2 = Bounds(Numbers=flatten(item_11))  # disabled
bnd_3 = Bounds(Numbers=flatten(item_12))  # disabled
panel_3 = Panel(wallacei_x.WallaceiGenomes)  # disabled
panel_4 = Panel(bnd_2)  # disabled
number_slider = Slider(2, range=0..12)  # disabled
gradientlibrary_2 = GradientLibrary(gradIndex=number_slider)  # -> colors; inputs gradIndex: Int32; disabled; same code as gradientlibrary
modelview_2 = ModelViewKaramba3D(Model=bmodes.ModelWithBucklingModesAsLoadCaseResults, ResultFactors=1, ResultCase=-1, Colors=gradientlibrary_2)  # -> Model, DeformedMesh, DeformedAxes, DeformedModel; disabled
shellview_2 = ShellViewKaramba3D(Model=modelview_2.Model, IndexOfLayer=0)  # -> Model, MeshesOfRenderedShells, LegendColors, LegendTags; disabled
range = Range(Domain=Domain(0, 1), Steps=10)  # disabled
col_2 = Colour(gradientlibrary)  # disabled
mjoin_3 = MeshJoin(Meshes=shellview_2.MeshesOfRenderedShells)  # disabled
bnd_4 = Bounds(Numbers=flatten(range))  # disabled
wbnaked_3 = WeaverbirdsNakedBoundary(MeshClosedPolylines=mesh)  # disabled
panel_5 = Panel("0.20")  # disabled
number_slider_2 = Slider(1416, range=0..2000)  # disabled
number_slider_3 = Slider(1332, range=0..2000)  # disabled
wbnaked_4 = WeaverbirdsNakedBoundary(MeshClosedPolylines=mjoin_3)  # disabled
swatch = ColourSwatch(SwatchColor=RGB(0, 0, 0))  # disabled
swatch_2 = ColourSwatch(SwatchColor=RGB(84, 84, 84))  # disabled
dash_2 = DashPattern(Curve=wbnaked_3, Pattern=panel_5)  # -> Dashes, Gaps; disabled
panel_6 = Panel("2")  # disabled
swatch_3 = ColourSwatch(SwatchColor=RGB(0, 0, 0))  # disabled

mjoin_4 = MeshJoin(Meshes=shellview_2.MeshesOfRenderedShells)  # disabled
cluster_2 = Cluster(col=col_2, C=swatch_3, D=bnd_4, X=number_slider_2, Y=number_slider_3)  # disabled
previewlw_3 = CustomPreviewLineweights(Geometry=wbnaked_4, Shader=swatch, Absolute=False)  # disabled
previewlw_4 = CustomPreviewLineweights(Geometry=dash_2.Dashes, Shader=swatch_2, Thickness=panel_6, Absolute=False)  # disabled

number_slider_4 = Slider(20.12, range=20..70)  # disabled
number_slider_5 = Slider(20, range=20..70)  # disabled
distributor = DistributeToGrid(
    FitnessValues=wallacei_x.FitnessValues,
    Data=wallacei_x.Data,
    WallaceiPhenotypes=wallacei_x.WPhenotypes,
    SizeOfTheGridInTheXDirection=number_slider_4,
    SizeOfTheGridInTheYDirection=number_slider_5,
    OutputOptions=0)  # -> DistributedFitnessValues, DistributedData, DistributedGeometries, simplify(DistributedMeshes), DistributedNumbers, GridLocations; disabled
geo_2 = Geometry(distributor.DistributedMeshes)  # disabled

# ==== cluster Cluster
gggrasshoppersettings = GgGrasshopperSettings(
    SettingsData_IFCSettings_Format="STEP",
    SettingsData_IFCSettings_GenerateOwnerHistory=True,
    SettingsData_IFCSettings_IdentifyObsolete=True,
    SettingsData_IFCSettings_LastUsedUnits="Meters",
    SettingsData_IFCSettings_Radians=True,
    SettingsData_IFCSettings_RepMapExport="NONE",
    SettingsData_IFCSettings_Target="Universal",
    SettingsData_IFCSettings_VersionIFC="IFC2x3",
    SettingsData_RevitSettings_Format="STEP",
    SettingsData_RevitSettings_GenerateOwnerHistory=True,
    SettingsData_RevitSettings_IdentifyObsolete=True,
    SettingsData_RevitSettings_LastUsedUnits="Meters",
    SettingsData_RevitSettings_Radians=True,
    SettingsData_RevitSettings_RepMapExport="NONE",
    SettingsData_RevitSettings_Target="Universal",
    SettingsData_RevitSettings_VersionIFC="IFC4")
Y = ClusterInput()
col = ClusterInput()
X = ClusterInput()
C = ClusterInput()
D = ClusterInput()
col_2 = Colour(col)
lng = ListLength(List=col_2)
multiplication = Multiplication(A=lng, B=Slider(5, range=0..10))
item = ListItem(List=col_2, Index=0, Wrap=True)  # -> graft(Item1), Item
graft = GraftTree(Tree=col_2, IncludeEmptyLists=True, IncludeNullItems=True)
entwine = Entwine(Branch00=graft, Branch01=item.Item1, FlattenInputs=True)  # -> graft(Result)
dup = DuplicateData(Data=entwine, Number=2, Order=True)  # -> simplify(Data)
flatten = FlattenTree(Tree=dup, Path="{0}")
number_slider = Slider(48, range=1..70)
number_slider_2 = Slider(12, range=1..50)
Y_2 = UnitY(Factor=1)  # -> expr("-x", UnitVector)
panel = Panel("11")
range = Range(Domain=D, Steps=lng)  # -> expr("Round(x,2)", Range)
panel_2 = Panel("2")
vec = VectorXYZ(XComponent=number_slider_2, YComponent=0, ZComponent=0)  # -> Vector, Length

rectangle = Rectangle(Plane=PlaneXY(0, 0, 0), XSize="10", YSize="0.5", Radius=0)  # -> Rectangle, Length
boundary = BoundarySurfaces(Edges=rectangle.Rectangle)
divide = DivideDomain(Domain=boundary, UCount=lng, VCount="1")
subsrf = Isotrim(Surface=boundary, Domain=divide)
explode = MeshExplode(Mesh=subsrf, Interpolate=False)
mcol = MeshColours(Mesh=explode, Colours=graft(col_2))  # -> flatten(Mesh)
mjoin = MeshJoin(Meshes=mcol)
weldvertices = MeshWeldVertices(Mesh=mjoin, Tolerance=0.01)  # -> RuntimeMessage, Mesh
pt = ConstructPoint(XCoordinate=X, YCoordinate=Y, ZCoordinate=0)

demesh = DeconstructMesh(Mesh=weldvertices.Mesh)  # -> Vertices, Faces, Colours, Normals
multiplication_2 = Multiplication(A=number_slider, B="10")
sort_pt = SortPoints(Points=demesh.Vertices)  # -> Points, Indices
pdecon = Deconstruct(Point=sort_pt.Points)  # -> XComponent, YComponent, ZComponent
mspray = MeshSpray(Mesh=weldvertices.Mesh, Points=sort_pt.Points, Colours=flatten, SprayMode=10)
division = Division(A=multiplication_2, B="2")
smaller = SmallerThan(FirstNumber=pdecon.YComponent, SecondNumber="0.1")  # -> SmallerThan, OrEqualTo
X_2 = UnitX(Factor=division)
rev = Reverse(Vector=X_2)
cull = CullPattern(List=sort_pt.Points, CullPattern=smaller.SmallerThan)
intcrv = Interpolate(Vertices=cull, Degree=3, Periodic=False, KnotStyle=1)  # -> Curve, Length, Domain
multiplication_3 = Multiplication(A=number_slider, B="10")
move = Move(Geometry=pt, Motion=rev)  # -> Geometry, Transform
X_3 = UnitX(Factor=multiplication_3)
divide_2 = DivideCurve(Curve=intcrv.Curve, Count=multiplication, Kinks=False)  # -> Points, Tangents, Parameters
move_2 = Move(Geometry=move.Geometry, Motion=X_3)  # -> Geometry, Transform
line = LineSDL(Start=divide_2.Points, Direction=Y_2, Length="0.1")

meshtoscreen = RenderMeshToScreen(Mesh=mspray, Location=move.Geometry, ScaleFactor=number_slider, Depth=0.95, Fixed=True, m_scWithvp=False)

dist = Distance(PointA=move.Geometry, PointB=move_2.Geometry)
range_2 = Range(Domain=dist, Steps=lng)
medges = MeshEdges(Mesh=weldvertices.Mesh)  # -> NakedEdges, InteriorEdges, NonManifoldEdges
vec_2 = VectorXYZ(XComponent=range_2, YComponent=Slider(30, range=0..100), ZComponent=0)  # -> Vector, Length
addition = Addition(A=move.Geometry, B=vec_2.Vector)
crvtoscreen = RenderCurveToScreen(
    Curve=[medges.NakedEdges, medges.InteriorEdges, medges.NonManifoldEdges, line],
    Location=move.Geometry,
    ScaleFactor=number_slider,
    Color=C,
    Thickness=1,
    Depth=0.95,
    Fixed=True,
    m_scWithvp=False)
subtraction = Subtraction(A=addition, B=vec.Vector)
texttoscreen = RenderTextToScreen(Text=range, Location=subtraction, Size=number_slider_2, Color=C, Font="Iosevka", m_scWithvp=False)
