# Grasshopper definition 210421_Geometry Generator_FMT_MP_PlateSubdivededBy1_Rev01.gh (Grasshopper 1.0.7)
# plug-ins: MeshEdit Components, treesloth01, Human, EleFront, Weaverbird, Wallacei, Silvereye, karambaGH

sheet_curve = Curve([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])
panel = Panel("""0.02
-0.02""")
genes = GenePool(Decimals=0, Maximum=1, Minimum=0, Value=[0, 0, 1, 0, 1, 1, 1, 0, 1, 0, 1, 0, 0, 0, 1, 1, 0, 1, 0, 1])
genes_2 = GenePool(Decimals=0, Maximum=1, Minimum=0, Value=[0, 0, 0, 0, 0, 0, 0, 0, 0, 0, 0, 1, 1, 1, 1, 0, 1, 0, 1, 1])
offset = OffsetCurve(Curve=graft(sheet_curve), Distance=panel, Plane=PlaneXY(0, 0, 0), Corners=1)
renameplz = Panel("""-0.08
0.08""")
shift = ShiftPaths(Data=offset, Offset=-1)
item = ListItem(List=renameplz, Index=genes_2, Wrap=True)
len = Length(Curve=shift)
sort = SortList(Keys=len, ValuesA=shift)  # -> Keys, ValuesA
item_2 = ListItem(List=sort.ValuesA, Index=0, Wrap=True)  # -> flatten(Item)

# ----
# Panel Group
crv = Curve(item_2)
area = Area(Geometry=crv)  # -> Area, Centroid
lng = ListLength(List=crv)
series = Series(Start=0, Step=1, Count=lng)
textdot = DefineTextDot(Text=series, Location=area.Centroid, Font="Arial", Size=14)

rec = Rectangle(item_2)
area_2 = Area(Geometry=item_2)  # -> Area, Centroid
explode = Explode(Curve=rec, Recursive=True)  # -> simplify(Segments), Vertices
len_2 = Length(Curve=explode.Segments)
sort_2 = SortList(Keys=len_2, ValuesA=explode.Segments)  # -> Keys, ValuesA
item_3 = ListItem(List=sort_2.ValuesA, Index=0, Wrap=True)  # -> Item, Item1
midpt = CurveMiddle(Curve=item_3.Item)
midpt_2 = CurveMiddle(Curve=item_3.Item1)
xy = XYPlane(Origin=area_2.Centroid)
pi = Pi(Factor=item)
vec2pt = Vector2Pt(PointA=midpt, PointB=midpt_2, Unitize=False)  # -> flatten(Vector), Length
align = AlignPlane(Plane=xy, Direction=vec2pt.Vector)  # -> Plane, Angle
prot = RotatePlane(Plane=align.Plane, Angle=pi)
deplane = DeconstructPlane(Plane=prot)  # -> Origin, XAxis, YAxis, ZAxis
rev = Reverse(Vector=deplane.XAxis)
graft = GraftTree(Tree=genes, IncludeEmptyLists=True, IncludeNullItems=True)
graft_2 = GraftTree(Tree=rev, IncludeEmptyLists=True, IncludeNullItems=True)
graft_3 = GraftTree(Tree=deplane.XAxis, IncludeEmptyLists=True, IncludeNullItems=True)
merge = Merge(Data1=graft_3, Data2=graft_2)
crv_2 = Curve(sheet_curve)
crv_3 = Curve(item_2)
item_4 = ListItem(List=simplify(merge), Index=simplify(graft), Wrap=True)  # -> flatten(Item)
explode_2 = Explode(Curve=crv_2, Recursive=True)  # -> Segments, Vertices
len_3 = Length(Curve=explode_2.Segments)
division = Division(A=len_3, B="0.75")
c_script = CSharpScript(
    centre=area_2.Centroid,
    direction=item_4,
    length=Slider(2.5, range=0..10),
    radius=Slider(0.33, range=0..1),
    widthTop=Slider(0.4, range=0..1),
    widthBottom=Slider(0.4, range=0..1))  # -> out, topCurve, centreLine, foldedLine, headHeight; inputs centre: Point3d, direction: Vector3d, length: Double, radius: Double, widthTop: Double, widthBottom: Double
# ---------- c_script: C# ----------
        //we want to work entirely within a set plane
        Plane cutPlane = Plane.WorldXY;
        cutPlane.Origin = centre;
        Vector3d yVector = new Vector3d(direction);
        yVector.Rotate(0.5 * Math.PI, cutPlane.ZAxis);

        cutPlane = new Plane(centre, direction, yVector);

        Point3d point1 = cutPlane.PointAt(-0.5 * length, 0.5 * widthTop);
        Point3d point2 = cutPlane.PointAt(-0.5 * length, -0.5 * widthTop);
        Point3d point3 = cutPlane.PointAt(0.5 * length, 0.5 * widthBottom);
        Point3d point4 = cutPlane.PointAt(0.5 * length, -0.5 * widthBottom);

        Polyline pLine = new Polyline() { point1, point3, point4, point2 };
        Curve filletCurve = Curve.CreateFilletCornersCurve(pLine.ToPolylineCurve(), widthBottom / 2, 0.01, 0.01);
        Line topLine = new Line(point1, point2);
        NurbsCurve topLineCurve = topLine.ToNurbsCurve();

        List<Curve> crvs = new List<Curve>() {filletCurve, topLineCurve};
        Curve[] joined = Curve.JoinCurves(crvs);
        topCurve = joined[0];

        Point3d c1 = 0.5 * (point1 + point2);
        Point3d c2 = 0.5 * (point3 + point4);
        centreLine = new Line(c1, c2).ToNurbsCurve();

        Plane arcPlane = new Plane(c1, direction, Vector3d.ZAxis);
        Arc radiusArc = new Arc(new Circle(arcPlane, radius), new Interval(0, 0.5 * Math.PI));
        radiusArc.Transform(Transform.Translation(new Vector3d(0, 0, -radius)));

        double remainingLineLength = length - radiusArc.Length;
        Point3d topPt = radiusArc.StartPoint;
        Point3d bottomPt = new Point3d(topPt.X, topPt.Y, topPt.Z - remainingLineLength);
        NurbsCurve foldedLinePartB = new Line(topPt, bottomPt).ToNurbsCurve();
        List<Curve> foldedLineCurves = new List<Curve>(){radiusArc.ToNurbsCurve(), foldedLinePartB};
        Curve[] joinedfoldedLine = Curve.JoinCurves(foldedLineCurves);
        Curve foldedLineComplete = joinedfoldedLine[0];
        foldedLineComplete.Domain = new Interval(0.0, 1.0);
        foldedLineComplete.Reverse();
        foldedLine = foldedLineComplete;
        headHeight = remainingLineLength + radius;
# ---------- end c_script ----------
divide = DivideCurve(Curve=explode_2.Segments, Count=division, Kinks=False)  # -> Points, Tangents, Parameters
boundary = BoundarySurfaces(Edges=item_2)  # -> simplify(graft(Surfaces))
crv_cp = CurveClosestPoint(Point=flatten(divide.Points), Curve=graft(crv_3))  # -> Point, Parameter, Distance
srfsplit = SurfaceSplit(Surface=boundary, Curves=simplify(graft(c_script.topCurve)))
smaller = SmallerThan(FirstNumber=crv_cp.Distance, SecondNumber="0.03")  # -> SmallerThan, OrEqualTo
boundary_2 = BoundarySurfaces(Edges=c_script.topCurve)
cull = CullPattern(List=crv_cp.Point, CullPattern=smaller.SmallerThan)
rdpoints = RemoveDuplicatePointsKaramba3D(Point=flatten(cull), LimitDistance=0.005)  # -> OutPoint, Info, Indexes
end = EndPoints(Curve=c_script.foldedLine)  # -> Start, End
item_5 = ListItem(List=srfsplit, Index=0, Wrap=True)  # -> flatten(Item)
flow = Flow(
    Geometry=boundary_2,
    Base=c_script.centreLine,
    Target=c_script.foldedLine,
    ReverseBase=False,
    ReverseTarget=False,
    Stretch=True,
    Rigid=False)
item_6 = ListItem(List=c_script.headHeight, Index=0, Wrap=True)
Z = UnitZ(Factor=item_6)
merge_2 = Merge(Data1=flatten(item_5), Data2=flatten(flow))
cps = ClosestPoints(Point=rdpoints.OutPoint, Cloud=rdpoints.OutPoint, Count="5")  # -> ClosestPoint, CPIndex, Distance
move = Move(Geometry=merge_2, Motion=Z)  # -> Geometry, Transform
item_7 = ListItem(List=cps.ClosestPoint, Index=0, Wrap=True)  # -> Item, Item1
move_2 = Move(Geometry=end.End, Motion=Z)  # -> Geometry, Transform
join = BrepJoin(Breps=move.Geometry)  # -> Breps, Closed
ln = Line(StartPoint=rdpoints.OutPoint, EndPoint=flatten(item_7.Item1))
len_4 = Length(Curve=ln)
smaller_2 = SmallerThan(FirstNumber=len_4, SecondNumber=0.15)  # -> SmallerThan, OrEqualTo
cull_2 = CullPattern(List=ln, CullPattern=smaller_2.SmallerThan)
rdlines = RemoveDuplicateLinesKaramba3D(Line=cull_2, LimitDistance=0.005)  # -> OutLine, Info, Indexes
vec = Vector(rdlines.OutLine)
python = GhPythonScript(linesVector=vec, line=rdlines.OutLine)  # -> out, a; inputs linesVector: list of Vector3d, line: list of Curve
# ---------- python: Python ----------
import Rhino.Geometry as rg

a = []

xVector = rg.Vector3d(1,0,0)
yVector = rg.Vector3d(0,1,0)

for i, lineVector in enumerate(linesVector):
    if  lineVector.IsParallelTo(xVector) or lineVector.IsParallelTo(yVector):
        a.append(line[i])
# ---------- end python ----------
crv_4 = Curve(python.a)
move_3 = Move(Geometry=crv_4, Motion=Z)  # -> Geometry, Transform
explode_3 = Explode(Curve=move_3.Geometry, Recursive=True)  # -> Segments, flatten(Vertices)
merge_3 = Merge(Data1=move_2.Geometry, Data2=explode_3.Vertices)
panel_2 = Panel("0.05")
rdpoints_2 = RemoveDuplicatePointsKaramba3D(Point=merge_3, LimitDistance=0.005)  # -> OutPoint, Info, Indexes
mesh_breps = MeshBrepsKaramba3D(
    Brep=graft(join.Breps),
    InclusionPoints=rdpoints_2.OutPoint,
    MeshResolution=Slider(0.1, range=0..1),
    EdgeRefinementFactor=0.67,
    PointReduction=False,
    SmoothingStepSize=0,
    SmoothingIterations=5)  # -> flatten(Mesh), Info
division_2 = Division(A="13", B="1.1")
matprops = MaterialPropertiesKaramba3D(
    FamilyOfMaterial="Steel",
    Name="S235",
    YoungsModulus_kN_cm2="7000",
    InPlaneShearModulus_kN_cm2="2700",
    TransverseShearModulus_kN_cm2="2700",
    SpecificWeight_kN_m3="27",
    CoefficientOfThermalExpansion_1_C=1e-05,
    YieldStrength_kN_cm2=division_2,
    mode="Isotrop")
panel_3 = Panel(matprops)
mesh = Mesh(mesh_breps.Mesh)
pt = Point(move_2.Geometry)
Z_2 = UnitZ(Factor="-0.15")
cross_section = CrossSectionKaramba3D(FamilyNameOfCrossSection="DefaultCroSec", Material=matprops, Height_cm=Slider(2, range=0..10), mode="Shell - Const")
move_4 = Move(Geometry=pt, Motion=Z_2)  # -> Geometry, Transform
ln_2 = Line(StartPoint=pt, EndPoint=move_4.Geometry)
meshtoshell = MeshToShellKaramba3D(Mesh=mesh, Identifier="Plate", CrossSection=cross_section, LimitDistance_m=0.005)  # -> Element, Points, Info
cross_section_2 = CrossSectionKaramba3D(
    FamilyNameOfCrossSection="DefaultCroSec",
    Material=matprops,
    Diameter_cm="2.0",
    WallThickness_cm="0",
    mode="Circular Hollow")
shatter = Shatter(Curve=ln_2, Parameters="0.50")
lng_2 = ListLength(List=item_2)
cross_section_3 = CrossSectionKaramba3D(
    FamilyNameOfCrossSection="DefaultCroSec",
    Material=matprops,
    Diameter_cm="2.0",
    WallThickness_cm="1.0",
    mode="Circular Hollow")
split = SplitList(List=mesh_breps.Mesh, Index=lng_2)  # -> ListA, ListB
neg = Negative(Value="0.25")
Z_3 = UnitZ(Factor=neg)
geo = Geometry(split.ListA)
supp = SupportKaramba3D(PosInd=move_4.Geometry, menu=[buttons(on, on, on, off, off, off)])
linetobeam = LineToBeamKaramba3D(Line=shatter, Identifier="Pin", CrossSection=cross_section_2, New=True, Remove=True, LimitDistance_m=0.005)  # -> Element, Points, Info
linetobeam_2 = LineToBeamKaramba3D(
    Line=move_3.Geometry,
    Identifier="Connection",
    CrossSection=cross_section_3,
    New=True,
    Remove=True,
    LimitDistance_m=0.005)  # -> Element, Points, Info
loads = LoadsKaramba3D(Vector=Vector(0, 0, -1), mode="Gravity")
loads_2 = LoadsKaramba3D(Vector=Z_3, Mesh=geo, LCase=0, mode="MeshLoad -Const.", menu=[buttons(off, on, off), buttons(on, off)])
load = LoadKaramba3D(flatten(loads))
assemble = AssembleModelKaramba3D(
    Elem=flatten([meshtoshell.Element, linetobeam_2.Element, linetobeam.Element]),
    Support=supp,
    Load=load,
    LimitDistance_m=0.005)  # -> Model, Info, Mass_kg, CenterOfGravity
analyze = AnalyzeKaramba3D(Model=assemble.Model)  # -> CalculatedModel, MaximumDisplacement_cm, ResultingForceOfGravity_kN, ElasticEnergy_kNm
gradientlibrary = GradientLibrary(gradIndex=Slider(7, range=0..12))  # -> colors; inputs gradIndex: Int32
#   port colors: A series of colors to be plugged into the "Ladybug_Legend Parameters" component.
# ---------- gradientlibrary: Python ----------
"""
Preset of gradient colors perfect for Data Visualisation
    Inputs:
        gradIndex: An index refering to one of the following possible gradients:
            0 - Orignal Ladybug
            1 - Nuanced Ladybug
            2 - Multi-colored Ladybug
            3 - Ecotect
            4 - Thermal Comfort Percentage
            5 - Thermal Comfort Colors
            6 - Shade Benefit/Harm
            7 - Shade Harm
            8 - Shade Benefit
            9 - CFD Colors 1
            10 - Radiation Benefit
            11 - Gsa10 Colour
            12 - Gsa9 Colour
    Returns:
        customColors: A series of colors.
"""

ghenv.Component.Name = "Gradient Library"
ghenv.Component.NickName = 'GradientLibrary'
#ghenv.Component.Message = 'GradientLibrary\nWIP'

import scriptcontext as sc
import Grasshopper.Kernel as gh
import System

gradientLibrary = {
        0: [System.Drawing.Color.FromArgb(75, 107, 169), System.Drawing.Color.FromArgb(115, 147, 202), System.Drawing.Color.FromArgb(170, 200, 247), System.Drawing.Color.FromArgb(193, 213, 208), System.Drawing.Color.FromArgb(245, 239, 103), System.Drawing.Color.FromArgb(252, 230, 74), System.Drawing.Color.FromArgb(239, 156, 21), System.Drawing.Color.FromArgb(234, 123, 0), System.Drawing.Color.FromArgb(234, 74, 0), System.Drawing.Color.FromArgb(234, 38, 0)],
        1: [System.Drawing.Color.FromArgb(49,54,149), System.Drawing.Color.FromArgb(69,117,180), System.Drawing.Color.FromArgb(116,173,209), System.Drawing.Color.FromArgb(171,217,233), System.Drawing.Color.FromArgb(224,243,248), System.Drawing.Color.FromArgb(255,255,191), System.Drawing.Color.FromArgb(254,224,144), System.Drawing.Color.FromArgb(253,174,97), System.Drawing.Color.FromArgb(244,109,67), System.Drawing.Color.FromArgb(215,48,39), System.Drawing.Color.FromArgb(165,0,38)],
        2: [System.Drawing.Color.FromArgb(4,25,145), System.Drawing.Color.FromArgb(7,48,224), System.Drawing.Color.FromArgb(7,88,255), System.Drawing.Color.FromArgb(1,232,255), System.Drawing.Color.FromArgb(97,246,156), System.Drawing.Color.FromArgb(166,249,86), System.Drawing.Color.FromArgb(254,244,1), System.Drawing.Color.FromArgb(255,121,0), System.Drawing.Color.FromArgb(239,39,0), System.Drawing.Color.FromArgb(138,17,0)],
        3: [System.Drawing.Color.FromArgb(0,0,255), System.Drawing.Color.FromArgb(53,0,202), System.Drawing.Color.FromArgb(107,0,148), System.Drawing.Color.FromArgb(160,0,95), System.Drawing.Color.FromArgb(214,0,41), System.Drawing.Color.FromArgb(255,12,0), System.Drawing.Color.FromArgb(255,66,0), System.Drawing.Color.FromArgb(255,119,0), System.Drawing.Color.FromArgb(255,173,0), System.Drawing.Color.FromArgb(255,226,0), System.Drawing.Color.FromArgb(255,255,0)],
        4: [System.Drawing.Color.FromArgb(0,0,0), System.Drawing.Color.FromArgb(110,0,153), System.Drawing.Color.FromArgb(255,0,0), System.Drawing.Color.FromArgb(255,255,102), System.Drawing.Color.FromArgb(255,255,255)],
        5: [System.Drawing.Color.FromArgb(0,136,255), System.Drawing.Color.FromArgb(200,225,255), System.Drawing.Color.FromArgb(255,255,255), System.Drawing.Color.FromArgb(255,230,230), System.Drawing.Color.FromArgb(255,0,0)],
        6: [System.Drawing.Color.FromArgb(5,48,97), System.Drawing.Color.FromArgb(33,102,172), System.Drawing.Color.FromArgb(67,147,195), System.Drawing.Color.FromArgb(146,197,222), System.Drawing.Color.FromArgb(209,229,240), System.Drawing.Color.FromArgb(255,255,255), System.Drawing.Color.FromArgb(253,219,199), System.Drawing.Color.FromArgb(244,165,130), System.Drawing.Color.FromArgb(214,96,77), System.Drawing.Color.FromArgb(178,24,43), System.Drawing.Color.FromArgb(103,0,31)],
        7: [System.Drawing.Color.FromArgb(255,255,255), System.Drawing.Color.FromArgb(253,219,199), System.Drawing.Color.FromArgb(244,165,130), System.Drawing.Color.FromArgb(214,96,77), System.Drawing.Color.FromArgb(178,24,43), System.Drawing.Color.FromArgb(103,0,31)],
        8: [System.Drawing.Color.FromArgb(255,255,255), System.Drawing.Color.FromArgb(209,229,240), System.Drawing.Color.FromArgb(146,197,222), System.Drawing.Color.FromArgb(67,147,195), System.Drawing.Color.FromArgb(33,102,172), System.Drawing.Color.FromArgb(5,48,97)],
        9: [System.Drawing.Color.FromArgb(0,16,120), System.Drawing.Color.FromArgb(38,70,160), System.Drawing.Color.FromArgb(5,180,222), System.Drawing.Color.FromArgb(16,180,109), System.Drawing.Color.FromArgb(59,183,35), System.Drawing.Color.FromArgb(143,209,19), System.Drawing.Color.FromArgb(228,215,29), System.Drawing.Color.FromArgb(246,147,17), System.Drawing.Color.FromArgb(243,74,0), System.Drawing.Color.FromArgb(255,0,0)],
        10: [System.Drawing.Color.FromArgb(0,191,48), System.Drawing.Color.FromArgb(255,238,184), System.Drawing.Color.FromArgb(255,0,0)],
        11: [System.Drawing.Color.FromArgb(204,0,71), System.Drawing.Color.FromArgb(255,182,71), System.Drawing.Color.FromArgb(206,255,115), System.Drawing.Color.FromArgb(26,180, 214),System.Drawing.Color.FromArgb(0,0,207)],
        12: [System.Drawing.Color.FromArgb(255, 51, 51), System.Drawing.Color.FromArgb(255, 170, 51), System.Drawing.Color.FromArgb(255, 255, 51), System.Drawing.Color.FromArgb(170, 255, 125), System.Drawing.Color.FromArgb(51, 255, 231), System.Drawing.Color.FromArgb(51, 170, 255), System.Drawing.Color.FromArgb(51,51, 255)]}
colors = gradientLibrary[gradIndex]
# ---------- end gradientlibrary ----------
lng_3 = ListLength(List=gradientlibrary)
gradientlibrary_2 = GradientLibrary(gradIndex=Slider(2, range=0..12))  # -> colors; inputs gradIndex: Int32; same code as gradientlibrary
ins = InsertItems(List=gradientlibrary, Item=ColourSwatch(SwatchColor=RGB(0, 123, 255)), Indices=lng_3, Wrap=True)
nodedisp = NodalDisplacementsKaramba3D(AnalyzedModel=analyze.CalculatedModel, ResultCase=0)  # -> AnalyzedModel, NodalTranslations_m, NodalRotations_rad
utilization = UtilizationOfElementsKaramba3D(AnalyzedModel=analyze.CalculatedModel, ResultCase=-1, mode="Shells")  # -> AnalyzedModel, flatten(Utilization)
analyzethii = AnalyzeThIIKaramba3D(Model=analyze.CalculatedModel, LoadCase=-1, RTolerance=1e-07, MaxIterations=50, NoTensionalNII=False)  # -> CalculatedModel, MaximumDisplacement_cm, ResultingForceOfGravity_kN, ElasticEnergy_kNm
devec = DeconstructVector(Vector=nodedisp.NodalTranslations_m)  # -> XComponent, YComponent, ZComponent; disabled
disassemble = DisassembleModelKaramba3D()  # -> Model, Point, Beam, Shell, Support, Load, Line, Mesh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
modelview = ModelViewKaramba3D(Model=analyze.CalculatedModel, ResultFactors=1, ResultCase=-1, Colors=gradientlibrary_2)  # -> Model, DeformedMesh, DeformedAxes, DeformedModel
vlen = VectorLength(Vector=nodedisp.NodalTranslations_m)
bmodes = BucklingModesKaramba3D(Model=analyzethii.CalculatedModel, FromIndex=1, NumberOfModes=1, MaximumNumberOfIterations=300, Epsilon=1e-07)  # -> ModelWithBucklingModesAsLoadCaseResults, BucklingLoadFactors
modelview_2 = ModelViewKaramba3D(Model=analyze.CalculatedModel, ResultFactors=1, ResultCase=-1, Colors=ins)  # -> Model, DeformedMesh, DeformedAxes, DeformedModel
abs = Absolute(Value=devec.XComponent)  # disabled
abs_2 = Absolute(Value=devec.YComponent)  # disabled
abs_3 = Absolute(Value=devec.ZComponent)  # disabled
sort_3 = SortList(Keys=abs_2)  # -> Keys, ValuesA; disabled
sort_4 = SortList(Keys=abs_3)  # -> Keys, ValuesA; disabled
sort_5 = SortList(Keys=vlen)  # -> Keys, ValuesA
sort_6 = SortList(Keys=utilization.Utilization)  # -> Keys, ValuesA
sort_7 = SortList(Keys=abs)  # -> Keys, ValuesA; disabled
num = Number(expr("Round(x,1)", bmodes.BucklingLoadFactors))
item_8 = ListItem(List=reverse(sort_3.Keys), Index=0, Wrap=True)  # disabled
item_9 = ListItem(List=reverse(sort_4.Keys), Index=0, Wrap=True)  # disabled
item_10 = ListItem(List=reverse(sort_5.Keys), Index=0, Wrap=True)
item_11 = ListItem(List=reverse(sort_7.Keys), Index=0, Wrap=True)  # disabled
item_12 = ListItem(List=reverse(sort_6.Keys), Index=0, Wrap=True)
shellview = ShellViewKaramba3D(Model=modelview_2.Model, IndexOfLayer=0)  # -> Model, MeshesOfRenderedShells, LegendColors, LegendTags
beamview = BeamViewKaramba3D(Model=modelview_2.Model)  # -> Model, MeshesOfRenderedBeams, DeformedBeamAxes, LegendColors, LegendTags
shellview_2 = ShellViewKaramba3D(Model=modelview.Model, IndexOfLayer=0)  # -> Model, MeshesOfRenderedShells, LegendColors, LegendTags
beamview_2 = BeamViewKaramba3D(Model=modelview.Model)  # -> Model, MeshesOfRenderedBeams, DeformedBeamAxes, LegendColors, LegendTags

col = Colour(gradientlibrary)
num_2 = Number(expr("Round(x*1000,0)", vlen))
bnd = Bounds(Numbers=flatten(num_2))

col_2 = Colour(gradientlibrary_2)
num_3 = Number(expr("Round(x*1000,0)", vlen))
bnd_2 = Bounds(Numbers=flatten(num_3))

one_over_x = OneOverX(Value=num)
wlc_displacement = Number(expr("Round(x*1000,1)", item_10))
wlc_displacement_x = Number(expr("Round(x*1000,1)", item_11))  # disabled
wlc_displacement_y = Number(expr("Round(x*1000,1)", item_8))  # disabled
wlc_displacement_z = Number(expr("Round(x*1000,1)", item_9))  # disabled
wlc_utilisation = Number(expr("Round(x*100,1)", item_12))
wlc_buckling = Number(one_over_x)
mjoin = MeshJoin(Meshes=shellview_2.MeshesOfRenderedShells)
wbnaked = WeaverbirdsNakedBoundary(MeshClosedPolylines=mesh)
mjoin_2 = MeshJoin(Meshes=shellview.MeshesOfRenderedShells)
wbnaked_2 = WeaverbirdsNakedBoundary(MeshClosedPolylines=mesh)

# ---- group: Performance parameters
header = Panel("""displacement DL+WIND: 
Utilisation: 
Buckling Factor: """)
entwine = Entwine(Branch00=wlc_displacement, Branch01=wlc_utilisation, Branch02=num, FlattenInputs=True)  # -> flatten(Result)
units = Panel(""" mm
 %
 """)
concat = Concatenate(FragmentA=header, FragmentB=entwine, FragmentC=units)
txt = Text(concat)
panel_4 = Panel(txt)
lng_4 = ListLength(List=txt)
series_2 = Series(Start=Slider(87, range=0..100), Step=Slider(30, range=0..100), Count=lng_4)
pt_2 = ConstructPoint(XCoordinate=Slider(63, range=0..1000), YCoordinate=series_2, ZCoordinate=0)
texttoscreen = RenderTextToScreen(
    Text=txt,
    Location=pt_2,
    Size=Slider(15, range=0..100),
    Color=ColourSwatch(SwatchColor=RGB(0, 0, 0)),
    Font="Inconsolata",
    m_scWithvp=False)

# ----
legend = Legend(Colour=shellview.LegendColors, Tags=shellview.LegendTags, LegendType=1)
wbnaked_3 = WeaverbirdsNakedBoundary(MeshClosedPolylines=mjoin)
dash = DashPattern(Curve=wbnaked, Pattern="0.20")  # -> Dashes, Gaps
dash_2 = DashPattern(Curve=wbnaked_2, Pattern="0.20")  # -> Dashes, Gaps
wbnaked_4 = WeaverbirdsNakedBoundary(MeshClosedPolylines=mjoin_2)
wallacei_x = WallaceiX(
    Genes=[genes_2, genes],
    Objectives=flatten([wlc_displacement, wlc_utilisation, wlc_buckling]),
    Phenotype=mjoin,
    allFitness="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",
    allFrontIdx="4|5;5|2;6|5;6|7;7|5;7|6;7|7;7|9;7|10;8|11;8|12;8|13;8|14;8|15;8|16;9|0;9|3;9|4;9|6;9|10;9|11;9|12;9|13",
    allGenomes="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",
    curFrontIdx="9|0;9|1;9|2;9|3;9|4;9|5;9|6;9|7;9|8;9|9;9|10;9|11;9|12;9|13;9|14;9|15;9|16;9|17;9|18;9|19",
    curFrontIdxSave="0|1;0|14;0|16;0|17;1|0;1|1;1|2;1|3;1|4;2|0;2|1;2|2;2|3;2|4;2|5;2|6;3|0;3|1;3|2;3|3;3|4;3|5;3|6;3|7;4|0;4|1;4|2;4|3;4|4;4|5;4|6;4|7;5|0;5|1;5|2;5|3;5|4;6|0;6|1;6|2;6|3;6|4;6|5;6|6;6|7;7|0;7|1;7|2;7|3;7|4;7|5;7|6;7|7;7|8;7|9;7|10;8|0;8|1;8|2;8|3;8|4;8|5;8|6;8|7;8|8;8|9;8|10;8|11;8|12;8|13;8|14;8|15;8|16;9|0;9|1;9|2;9|3;9|4;9|5;9|6;9|7;9|8;9|9;9|10;9|11;9|12;9|13;9|14;9|15;9|16;9|17;9|18;9|19",
    popGen="20,10",
    total="1822922",
    wlcDone=True)  # -> WallaceiGenomes, FitnessValues, Data, WPhenotypes; disabled
panel_5 = Panel(wlc_utilisation)
gh_silvereye = Silvereye(SilvereyeData_fitness_fcn=wlc_displacement, SilvereyeData_parameter=[genes_2, genes])

mjoin_3 = MeshJoin(Meshes=shellview.MeshesOfRenderedShells)
cluster = Cluster(col=col, C=ColourSwatch(SwatchColor=RGB(0, 0, 0)), D=bnd, X=Slider(1416, range=0..2000), Y=Slider(1332, range=0..2000))
previewlw = CustomPreviewLineweights(Geometry=dash_2.Dashes, Shader=ColourSwatch(SwatchColor=RGB(84, 84, 84)), Thickness="2", Absolute=False)
previewlw_2 = CustomPreviewLineweights(Geometry=wbnaked_4, Shader=ColourSwatch(SwatchColor=RGB(0, 0, 0)), Absolute=False)

mjoin_4 = MeshJoin(Meshes=shellview_2.MeshesOfRenderedShells)
cluster_2 = Cluster(
    col=col_2,
    C=ColourSwatch(SwatchColor=RGB(0, 0, 0)),
    D=bnd_2,
    X=Slider(1416, range=0..2000),
    Y=Slider(1332, range=0..2000))
previewlw_3 = CustomPreviewLineweights(Geometry=dash.Dashes, Shader=ColourSwatch(SwatchColor=RGB(84, 84, 84)), Thickness="2", Absolute=False)
previewlw_4 = CustomPreviewLineweights(Geometry=wbnaked_3, Shader=ColourSwatch(SwatchColor=RGB(0, 0, 0)), Absolute=False)

panel_6 = Panel("5")  # disabled
item_13 = ListItem(List=wallacei_x.FitnessValues, Index=0, Wrap=True)  # disabled
item_14 = ListItem(List=wallacei_x.FitnessValues, Index=panel_6, Wrap=True)  # disabled
bnd_3 = Bounds(Numbers=flatten(item_13))  # disabled
bnd_4 = Bounds(Numbers=flatten(item_14))  # disabled
panel_7 = Panel(wallacei_x.WallaceiGenomes)  # disabled
panel_8 = Panel(bnd_3)  # disabled
number_slider = Slider(2, range=0..12)  # disabled
gradientlibrary_3 = GradientLibrary(gradIndex=number_slider)  # -> colors; inputs gradIndex: Int32; disabled; same code as gradientlibrary
modelview_3 = ModelViewKaramba3D(Model=bmodes.ModelWithBucklingModesAsLoadCaseResults, ResultFactors=1, ResultCase=-1, Colors=gradientlibrary_3)  # -> Model, DeformedMesh, DeformedAxes, DeformedModel; disabled
shellview_3 = ShellViewKaramba3D(Model=modelview_3.Model, IndexOfLayer=0)  # -> Model, MeshesOfRenderedShells, LegendColors, LegendTags; disabled
range = Range(Domain=Domain(0, 1), Steps=10)  # disabled
col_3 = Colour(gradientlibrary_2)  # disabled
mjoin_5 = MeshJoin(Meshes=shellview_3.MeshesOfRenderedShells)  # disabled
bnd_5 = Bounds(Numbers=flatten(range))  # disabled
wbnaked_5 = WeaverbirdsNakedBoundary(MeshClosedPolylines=mesh)  # disabled
panel_9 = Panel("0.20")  # disabled
number_slider_2 = Slider(1416, range=0..2000)  # disabled
number_slider_3 = Slider(1332, range=0..2000)  # disabled
wbnaked_6 = WeaverbirdsNakedBoundary(MeshClosedPolylines=mjoin_5)  # disabled
swatch = ColourSwatch(SwatchColor=RGB(0, 0, 0))  # disabled
swatch_2 = ColourSwatch(SwatchColor=RGB(84, 84, 84))  # disabled
dash_3 = DashPattern(Curve=wbnaked_5, Pattern=panel_9)  # -> Dashes, Gaps; disabled
panel_10 = Panel("2")  # disabled
swatch_3 = ColourSwatch(SwatchColor=RGB(0, 0, 0))  # disabled

mjoin_6 = MeshJoin(Meshes=shellview_3.MeshesOfRenderedShells)  # disabled
cluster_3 = Cluster(col=col_3, C=swatch_3, D=bnd_5, X=number_slider_2, Y=number_slider_3)  # disabled
previewlw_5 = CustomPreviewLineweights(Geometry=wbnaked_6, Shader=swatch, Absolute=False)  # disabled
previewlw_6 = CustomPreviewLineweights(Geometry=dash_3.Dashes, Shader=swatch_2, Thickness=panel_10, Absolute=False)  # disabled

# ----
# Selected Element
model = ModelKaramba3D(analyze.CalculatedModel)
list = ValueList({"&Pin"}, selected="&Pin")
lc = Number()
utilization_2 = UtilizationOfElementsKaramba3D(
    AnalyzedModel=model,
    ElemIdentifiers=list,
    ResultCase=-1,
    NumberOfSamplePoints=3,
    ElasticDesign=Toggle(True),
    GammaM0=1,
    GammaM1=1,
    WithDetails=False,
    mode="Beams")  # -> AnalyzedModel, Utilization, SigMax_kN_cm2, SigMin_kN_cm2, TauMax_kN_cm2, UtilN, UtilVy, UtilVz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
bnd_6 = Bounds(Numbers=utilization_2.Utilization)  # -> flatten(Domain)
sort_8 = SortList(Keys=utilization_2.Utilization)  # -> Keys, ValuesA
for_each_load_case = Panel(bnd_6)
repeat = RepeatData(Data="0.99", Length=3)
entwine_2 = Entwine(Branch0X=sort_8.Keys, Branch1X=repeat, FlattenInputs=False)
graph = QuickGraph(entwine_2, SortOrder=0)
bar_graph = BarGraph(sort_8.Keys, BarColor=RGB(255, 0, 90))
disassemble_2 = DisassembleModelKaramba3D(Model=model)  # -> Model, Point, Beam, Shell, Support, Load, Line, Mesh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
select = SelectElementKaramba3D(Elements=disassemble_2.Beam, ElementIdentifiers=list)  # -> SelectedElements, RejectedElements
disassemble_3 = DisassembleElementKaramba3D(Element=select.SelectedElements)  # -> Element, ElementIdentifier, simplify(AxisOfElement), CrossSection, Joints, Material, LocalCoordinateSystem, ElementIsActive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
larger = LargerThan(FirstNumber=utilization_2.Utilization, SecondNumber="0.95")  # -> LargerThan, OrEqualTo
shift_2 = ShiftPaths(Data=disassemble_3.AxisOfElement, Offset=-1)
cull_3 = CullPattern(List=shift_2, CullPattern=larger.LargerThan)
curvepoint = PointOnCurve(cull_3, parameter=0.5)
dots = DotDisplay(Point=curvepoint, Colour=ColourSwatch(SwatchColor=RGB(255, 255, 111)), Size="0.1")
panel_11 = Panel(curvepoint)

bnd_7 = Bounds(Numbers=flatten(utilization_2.Utilization))  # -> flatten(Domain)
all_loadcases = Panel(bnd_7)

number_slider_4 = Slider(20.12, range=20..70)  # disabled
number_slider_5 = Slider(20, range=20..70)  # disabled
distributor = DistributeToGrid(
    FitnessValues=wallacei_x.FitnessValues,
    Data=wallacei_x.Data,
    WallaceiPhenotypes=wallacei_x.WPhenotypes,
    SizeOfTheGridInTheXDirection=number_slider_4,
    SizeOfTheGridInTheYDirection=number_slider_5,
    OutputOptions=0)  # -> DistributedFitnessValues, DistributedData, DistributedGeometries, simplify(DistributedMeshes), DistributedNumbers, GridLocations; disabled
geo_2 = Geometry(distributor.DistributedMeshes)  # disabled

# ----
# Input model
# Input element ids and
# at least 2 loadcases
utilization_3 = UtilizationOfElementsKaramba3D(AnalyzedModel=analyze.CalculatedModel, ElemIdentifiers="Plate", ResultCase=graft(-1), mode="Shells")  # -> AnalyzedModel, simplify(flatten(Utilization))
path_mapper = PathMapper(utilization_3.Utilization, source="{a;b}", target="{b;a}")
disassemble_4 = DisassembleModelKaramba3D(Model=analyze.CalculatedModel)  # -> Model, Point, Beam, Shell, Support, Load, Line, Mesh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
data = Data(path_mapper)
bnd_8 = Bounds(Numbers=path_mapper)
flip_last = FlipLast(Data=data)
explode_4 = MeshExplode(Mesh=disassemble_4.Mesh, Interpolate=False)  # -> simplify(flatten(Faces))
gradient = Gradient(
    LowerLimit=0,
    UpperLimit=Slider(0.489, range=0.3..1),
    Parameter=utilization_3.Utilization,
    stops=[0: RGB(0, 128, 0), 0.5: RGB(255, 255, 0), 0.984: RGB(255, 0, 0)])
graft_4 = GraftTree(Tree=explode_4, IncludeEmptyLists=True, IncludeNullItems=True)

graft_5 = GraftTree(Tree=gradient, IncludeEmptyLists=True, IncludeNullItems=True)

mcol = MeshColours(Mesh=graft_4, Colours=simplify(graft_5))
shift_3 = ShiftPaths(Data=simplify(mcol), Offset=-1)
mesh_join = MeshJoin(Meshes=shift_3)

# ==== cluster Cluster
gggrasshoppersettings = GgGrasshopperSettings(
    SettingsData_IFCSettings_Format="STEP",
    SettingsData_IFCSettings_GenerateOwnerHistory=True,
    SettingsData_IFCSettings_IdentifyObsolete=True,
    SettingsData_IFCSettings_LastUsedUnits="Meters",
    SettingsData_IFCSettings_Radians=True,
    SettingsData_IFCSettings_RepMapExport="NONE",
    SettingsData_IFCSettings_Target="Universal",
    SettingsData_IFCSettings_VersionIFC="IFC2x3",
    SettingsData_RevitSettings_Format="STEP",
    SettingsData_RevitSettings_GenerateOwnerHistory=True,
    SettingsData_RevitSettings_IdentifyObsolete=True,
    SettingsData_RevitSettings_LastUsedUnits="Meters",
    SettingsData_RevitSettings_Radians=True,
    SettingsData_RevitSettings_RepMapExport="NONE",
    SettingsData_RevitSettings_Target="Universal",
    SettingsData_RevitSettings_VersionIFC="IFC4")
Y = ClusterInput()
col = ClusterInput()
X = ClusterInput()
C = ClusterInput()
D = ClusterInput()
col_2 = Colour(col)
lng = ListLength(List=col_2)
multiplication = Multiplication(A=lng, B=Slider(5, range=0..10))
item = ListItem(List=col_2, Index=0, Wrap=True)  # -> graft(Item1), Item
graft = GraftTree(Tree=col_2, IncludeEmptyLists=True, IncludeNullItems=True)
entwine = Entwine(Branch00=graft, Branch01=item.Item1, FlattenInputs=True)  # -> graft(Result)
dup = DuplicateData(Data=entwine, Number=2, Order=True)  # -> simplify(Data)
flatten = FlattenTree(Tree=dup, Path="{0}")
number_slider = Slider(48, range=1..70)
number_slider_2 = Slider(12, range=1..50)
Y_2 = UnitY(Factor=1)  # -> expr("-x", UnitVector)
panel = Panel("11")
range = Range(Domain=D, Steps=lng)  # -> expr("Round(x,2)", Range)
panel_2 = Panel("2")
vec = VectorXYZ(XComponent=number_slider_2, YComponent=0, ZComponent=0)  # -> Vector, Length

rectangle = Rectangle(Plane=PlaneXY(0, 0, 0), XSize="10", YSize="0.5", Radius=0)  # -> Rectangle, Length
boundary = BoundarySurfaces(Edges=rectangle.Rectangle)
divide = DivideDomain(Domain=boundary, UCount=lng, VCount="1")
subsrf = Isotrim(Surface=boundary, Domain=divide)
explode = MeshExplode(Mesh=subsrf, Interpolate=False)
mcol = MeshColours(Mesh=explode, Colours=graft(col_2))  # -> flatten(Mesh)
mjoin = MeshJoin(Meshes=mcol)
weldvertices = MeshWeldVertices(Mesh=mjoin, Tolerance=0.01)  # -> RuntimeMessage, Mesh
pt = ConstructPoint(XCoordinate=X, YCoordinate=Y, ZCoordinate=0)

demesh = DeconstructMesh(Mesh=weldvertices.Mesh)  # -> Vertices, Faces, Colours, Normals
multiplication_2 = Multiplication(A=number_slider, B="10")
sort_pt = SortPoints(Points=demesh.Vertices)  # -> Points, Indices
pdecon = Deconstruct(Point=sort_pt.Points)  # -> XComponent, YComponent, ZComponent
mspray = MeshSpray(Mesh=weldvertices.Mesh, Points=sort_pt.Points, Colours=flatten, SprayMode=10)
division = Division(A=multiplication_2, B="2")
smaller = SmallerThan(FirstNumber=pdecon.YComponent, SecondNumber="0.1")  # -> SmallerThan, OrEqualTo
X_2 = UnitX(Factor=division)
rev = Reverse(Vector=X_2)
cull = CullPattern(List=sort_pt.Points, CullPattern=smaller.SmallerThan)
intcrv = Interpolate(Vertices=cull, Degree=3, Periodic=False, KnotStyle=1)  # -> Curve, Length, Domain
multiplication_3 = Multiplication(A=number_slider, B="10")
move = Move(Geometry=pt, Motion=rev)  # -> Geometry, Transform
X_3 = UnitX(Factor=multiplication_3)
divide_2 = DivideCurve(Curve=intcrv.Curve, Count=multiplication, Kinks=False)  # -> Points, Tangents, Parameters
move_2 = Move(Geometry=move.Geometry, Motion=X_3)  # -> Geometry, Transform
line = LineSDL(Start=divide_2.Points, Direction=Y_2, Length="0.1")

meshtoscreen = RenderMeshToScreen(Mesh=mspray, Location=move.Geometry, ScaleFactor=number_slider, Depth=0.95, Fixed=True, m_scWithvp=False)

dist = Distance(PointA=move.Geometry, PointB=move_2.Geometry)
range_2 = Range(Domain=dist, Steps=lng)
medges = MeshEdges(Mesh=weldvertices.Mesh)  # -> NakedEdges, InteriorEdges, NonManifoldEdges
vec_2 = VectorXYZ(XComponent=range_2, YComponent=Slider(30, range=0..100), ZComponent=0)  # -> Vector, Length
addition = Addition(A=move.Geometry, B=vec_2.Vector)
crvtoscreen = RenderCurveToScreen(
    Curve=[medges.NakedEdges, medges.InteriorEdges, medges.NonManifoldEdges, line],
    Location=move.Geometry,
    ScaleFactor=number_slider,
    Color=C,
    Thickness=1,
    Depth=0.95,
    Fixed=True,
    m_scWithvp=False)
subtraction = Subtraction(A=addition, B=vec.Vector)
texttoscreen = RenderTextToScreen(Text=range, Location=subtraction, Size=number_slider_2, Color=C, Font="Iosevka", m_scWithvp=False)
