# Grasshopper definition MusmeciBridge.gh (Grasshopper 1.0.7)
# plug-ins: MeshEdit Components, Pufferfish, Human, Kangaroo2 Components, karambaGH

crv = Curve(<curve referenced from the Rhino model>)
# Format Engineers CAD Information Issue Disclaimer
# 
# Project: PROJECT NAME
# 
# You should use this model for reference purposes only to assist in co-ordinating your work and is supplementary to formally issued drawings. Once the data is introduced into your own CAD or other system Format Engineers Ltd. can take no responsibility for its accuracy.
# 
# The last set of formally issued paper drawings are the contractual documents which represent the current stage of design development. If you have any queries, please contact the project CAD co-ordinator or the CAD Development Team.
# 
# Changes:
# 
# YYYY-MM-DD: Summary of changes
# 
# Usage notes:
# 
# This definition includes a basic implementation of Merbarki's Farthest Point Seeding algorithm (2005), adapted for tracing lines of principal curvature on NURBS surfaces. Requires modified Triangle.NET, if this isn't attached then... good luck! There are currently two main limitations: (a) this implementation measures density in parameter space, and (b) it doesn't include the dynamic refinement of density that Mebarki suggests.
srf = Surface(crv)
mesh_uv = MeshSurface(Surface=srf, UCount="23", VCount="51", Overhang=True, Equalize=False)
crv_2 = Curve([<curve referenced from the Rhino model> x13])
facen = FaceNormals(Mesh=mesh_uv)  # -> Centers, Normals
incurves = PointInCurves(Point=facen.Centers, Curves=crv_2)  # -> Relationship, Index, Point
cullf = CullFaces(Mesh=mesh_uv, Pattern=incurves.Relationship)
ground_point = Curve([<curve referenced from the Rhino model> x4])
upper_support = Curve([<curve referenced from the Rhino model> x4])
demesh = DeconstructMesh(Mesh=cullf)  # -> Vertices, Faces, Colours, Normals
incurves_2 = PointInCurves(Point=demesh.Vertices, Curves=upper_support)  # -> Relationship, Index, Point
incurves_3 = PointInCurves(Point=demesh.Vertices, Curves=ground_point)  # -> Relationship, Index, Point
mesh = Mesh(cullf)
cull = CullPattern(List=demesh.Vertices, CullPattern=incurves_2.Relationship)
cull_2 = CullPattern(List=demesh.Vertices, CullPattern=incurves_3.Relationship)
number_slider = Slider(0.535, range=0..1)
number_slider_2 = Slider(100, range=1..100)
pt = Point(cull)
pt_2 = Point(cull_2)
Z = UnitZ(Factor=Slider(6, range=0..6))
explode = MeshExplode(Mesh=mesh, Interpolate=False)
number_slider_3 = Slider(60.882, range=1..100)
medges = MeshEdges(Mesh=mesh)  # -> NakedEdges, InteriorEdges, NonManifoldEdges
move = Move(Geometry=pt, Motion=Z)  # -> Geometry, Transform
crv_3 = Curve([medges.NakedEdges, medges.InteriorEdges])
demesh_2 = DeconstructMesh(Mesh=explode)  # -> Vertices, Faces, Colours, Normals
multiplication = Multiplication(A=crv_3, B=Slider(0, range=0..1))
anchor = Anchor(Point=pt_2, Strength=10000)
anchor_2 = Anchor(Point=pt, Target=move.Geometry, Strength=10000)
item = ListItem(List=demesh_2.Vertices, Index=0, Wrap=True)  # -> Item, Item1, Item2, Item3
length_line = LengthLine(Line=crv_3, Length=multiplication, Strength=number_slider_3)
ln = Line(StartPoint=item.Item, EndPoint=item.Item2)
ln_2 = Line(StartPoint=item.Item1, EndPoint=item.Item3)
length_line_2 = LengthLine(Line=flatten([ln, ln_2]), Strength=number_slider_3)
show = Show(G=mesh)
show_2 = Show(G=[pt, pt_2])
entwine = Entwine(
    Branch00=show,
    Branch01=length_line,
    Branch02=length_line_2,
    Branch03=anchor_2,
    Branch04=anchor,
    Branch05=show_2,
    FlattenInputs=True)
bouncysolver = BouncySolver(GoalObjects=entwine, Reset=Button(), Threshold=1e-15, Tolerance=0.01, Damping=0.99, Iterations=10, On=Toggle(True))  # -> I, V, O
unflatten = UnflattenTree(Tree=bouncysolver.O, Guide=entwine)
bang = ExplodeTree(Data=unflatten)  # -> Branch0, Branch1, Branch2, Branch3, Branch4, Branch5
mesh_2 = Mesh(bang.Branch0)
move_2 = Move(Geometry=crv, Motion=Z)  # -> Geometry, Transform
mesh_3 = Mesh(mesh_2)  # disabled
medges_2 = MeshEdges(Mesh=mesh_3)  # -> NakedEdges, InteriorEdges, NonManifoldEdges; disabled
swatch = ColourSwatch(SwatchColor=RGB(0, 0, 0))  # disabled
crv_4 = Curve(medges_2.NakedEdges)  # disabled
swatch_2 = ColourSwatch(SwatchColor=RGB(0, 0, 0))  # disabled
swatch_3 = ColourSwatch(SwatchColor=RGB(255, 255, 255))  # disabled
crv_5 = Curve(medges_2.InteriorEdges)  # disabled
panel = Panel("3")  # disabled
panel_2 = Panel("1")  # disabled
preview = CustomPreview(Geometry=mesh_3, Material=swatch_3)  # disabled
previewlw = CustomPreviewLineweights(Geometry=crv_4, Shader=swatch_3, Thickness=panel, Absolute=False)  # disabled
panel_3 = Panel("-10")  # disabled
previewlw_2 = CustomPreviewLineweights(Geometry=crv_5, Shader=swatch_3, Thickness=panel_2, Absolute=False)  # disabled
pt_3 = Point(bang.Branch5)
Z_2 = UnitZ(Factor=panel_3)  # disabled
supp = SupportKaramba3D(PosInd=pt_3, menu=[buttons(on, on, on, on, on, on)])  # disabled
meshtoshell = MeshToShellKaramba3D(Mesh=mesh_3, LimitDistance_m=0.005)  # -> Element, Points, Info; disabled
loads = LoadsKaramba3D(Vector=Z_2, LCase=0, mode="Gravity")  # disabled
assemble = AssembleModelKaramba3D(Elem=meshtoshell.Element, Support=supp, Load=loads, LimitDistance_m=0.005)  # -> Model, Info, Mass_kg, CenterOfGravity; disabled
analyze = AnalyzeKaramba3D(Model=assemble.Model)  # -> CalculatedModel, MaximumDisplacement_cm, ResultingForceOfGravity_kN, ElasticEnergy_kNm; disabled
disassemble = DisassembleModelKaramba3D(Model=analyze.CalculatedModel)  # -> Model, Point, Beam, Shell, Support, Load, Line, Mesh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; disabled
nodedisp = NodalDisplacementsKaramba3D(AnalyzedModel=analyze.CalculatedModel, ResultCase=0)  # -> AnalyzedModel, NodalTranslations_m, NodalRotations_rad; disabled
vlen = VectorLength(Vector=nodedisp.NodalTranslations_m)  # disabled
number_slider_4 = Slider(0.19, range=0..0.4)  # disabled
number_slider_5 = Slider(0.121, range=0..2)  # disabled
bnd = Bounds(Numbers=vlen)  # disabled
remap = RemapNumbers(Value=vlen, Source=bnd, Target=Domain(0, 1))  # -> Mapped, Clipped; disabled
dom = ConstructDomain(DomainStart=number_slider_5, DomainEnd=number_slider_4)  # disabled
swatch_4 = ColourSwatch(SwatchColor=RGB(204, 0, 71))  # disabled
swatch_5 = ColourSwatch(SwatchColor=RGB(255, 182, 71))  # disabled
swatch_6 = ColourSwatch(SwatchColor=RGB(206, 255, 115))  # disabled
swatch_7 = ColourSwatch(SwatchColor=RGB(26, 180, 214))  # disabled
swatch_8 = ColourSwatch(SwatchColor=RGB(0, 0, 207))  # disabled
col = Colour(reverse([swatch_4, swatch_5, swatch_6, swatch_7, swatch_8]))  # disabled
remap_2 = RemapNumbers(Value=vlen, Source=bnd, Target=dom)  # -> Mapped, Clipped; disabled
panel_4 = Panel("0.1")  # disabled
twnthrucols = TweenThroughColors(
    Colors=col,
    Factor=remap.Mapped,
    Normalized=True,
    Equalized=False,
    Weighted=False,
    Degree=3,
    InterpolationType=0,
    Alpha=True)  # disabled
dots = DotDisplay(Point=disassemble.Point, Colour=twnthrucols, Size=remap_2.Mapped)  # disabled
