# Grasshopper definition MusmeciBridge_Coarser.gh (Grasshopper 1.0.7)
# plug-ins: MeshEdit Components, Pufferfish, Human, Weaverbird, Kangaroo2 Components, IguanaMesh, karambaGH

crv = Curve(<curve referenced from the Rhino model>)
# Format Engineers CAD Information Issue Disclaimer
# 
# Project: PROJECT NAME
# 
# You should use this model for reference purposes only to assist in co-ordinating your work and is supplementary to formally issued drawings. Once the data is introduced into your own CAD or other system Format Engineers Ltd. can take no responsibility for its accuracy.
# 
# The last set of formally issued paper drawings are the contractual documents which represent the current stage of design development. If you have any queries, please contact the project CAD co-ordinator or the CAD Development Team.
# 
# Changes:
# 
# YYYY-MM-DD: Summary of changes
# 
# Usage notes:
# 
# This definition includes a basic implementation of Merbarki's Farthest Point Seeding algorithm (2005), adapted for tracing lines of principal curvature on NURBS surfaces. Requires modified Triangle.NET, if this isn't attached then... good luck! There are currently two main limitations: (a) this implementation measures density in parameter space, and (b) it doesn't include the dynamic refinement of density that Mebarki suggests.
srf = Surface(crv)
mesh_uv = MeshSurface(Surface=srf, UCount="23", VCount="51", Overhang=True, Equalize=False)
crv_2 = Curve([<curve referenced from the Rhino model> x13])
facen = FaceNormals(Mesh=mesh_uv)  # -> Centers, Normals
incurves = PointInCurves(Point=facen.Centers, Curves=crv_2)  # -> Relationship, Index, Point
cullf = CullFaces(Mesh=mesh_uv, Pattern=incurves.Relationship)
ground_point = Curve([<curve referenced from the Rhino model> x4])
upper_support = Curve([<curve referenced from the Rhino model> x4])
demesh = DeconstructMesh(Mesh=cullf)  # -> Vertices, Faces, Colours, Normals
incurves_2 = PointInCurves(Point=demesh.Vertices, Curves=upper_support)  # -> Relationship, Index, Point
incurves_3 = PointInCurves(Point=demesh.Vertices, Curves=ground_point)  # -> Relationship, Index, Point
mesh = Mesh(cullf)
cull = CullPattern(List=demesh.Vertices, CullPattern=incurves_2.Relationship)
cull_2 = CullPattern(List=demesh.Vertices, CullPattern=incurves_3.Relationship)
number_slider = Slider(0.535, range=0..1)
number_slider_2 = Slider(100, range=1..100)
pt = Point(cull)
pt_2 = Point(cull_2)
Z = UnitZ(Factor=Slider(6, range=0..6))
explode = MeshExplode(Mesh=mesh, Interpolate=False)
number_slider_3 = Slider(60.882, range=1..100)
medges = MeshEdges(Mesh=mesh)  # -> NakedEdges, InteriorEdges, NonManifoldEdges
move = Move(Geometry=pt, Motion=Z)  # -> Geometry, Transform
crv_3 = Curve([medges.NakedEdges, medges.InteriorEdges])
demesh_2 = DeconstructMesh(Mesh=explode)  # -> Vertices, Faces, Colours, Normals
multiplication = Multiplication(A=crv_3, B=Slider(0, range=0..1))
anchor = Anchor(Point=pt_2, Strength="10000000")
anchor_2 = Anchor(Point=pt, Target=move.Geometry, Strength="10000000")
item = ListItem(List=demesh_2.Vertices, Index=0, Wrap=True)  # -> Item, Item1, Item2, Item3
length_line = LengthLine(Line=crv_3, Length=multiplication, Strength=number_slider_3)
ln = Line(StartPoint=item.Item, EndPoint=item.Item2)
ln_2 = Line(StartPoint=item.Item1, EndPoint=item.Item3)
length_line_2 = LengthLine(Line=flatten([ln, ln_2]), Strength=number_slider_3)
show = Show(G=mesh)
show_2 = Show(G=[pt, pt_2])
entwine = Entwine(
    Branch00=show,
    Branch01=length_line,
    Branch02=length_line_2,
    Branch03=anchor_2,
    Branch04=anchor,
    Branch05=show_2,
    FlattenInputs=True)
bouncysolver = BouncySolver(GoalObjects=entwine, Reset=Button(), Threshold=1e-15, Tolerance=0.01, Damping=0.99, Iterations=10, On=Toggle(True))  # -> I, V, O
unflatten = UnflattenTree(Tree=bouncysolver.O, Guide=entwine)
filter = StreamFilter(Gate=Toggle(True), Stream1=unflatten)
bang = ExplodeTree(Data=filter)  # -> Branch0, Branch1, Branch2, Branch3, Branch4, Branch5
move_2 = Move(Geometry=crv, Motion=Z)  # -> Geometry, Transform
pt_3 = Point(bang.Branch5)
crv_4 = Curve(reparameterize(move_2.Geometry))
crv_cp = CurveClosestPoint(Point=pt_3, Curve=crv_4)  # -> Point, Parameter, Distance
smaller = SmallerThan(FirstNumber=crv_cp.Distance, SecondNumber="0.01")  # -> SmallerThan, OrEqualTo
cull_3 = CullPattern(List=crv_cp.Parameter, CullPattern=smaller.SmallerThan)
mesh_2 = Mesh(bang.Branch0)
shatter = Shatter(Curve=crv_4, Parameters=cull_3)
explode_2 = Explode(Curve=shatter, Recursive=True)  # -> Segments, Vertices
duppt = RemoveDuplicatePts(Points=flatten(explode_2.Vertices), Tolerance=0.01)
clean = CombineClean(Meshes=mesh_2)
demesh_3 = DeconstructMesh(Mesh=clean)  # -> Vertices, Faces, Colours, Normals
mesh_breps = MeshBrepsKaramba3D(
    Brep=crv_4,
    InclusionPoints=duppt,
    MeshResolution=1,
    EdgeRefinementFactor=0.67,
    PointReduction=False,
    SmoothingStepSize=0,
    SmoothingIterations=5)  # -> Mesh, Info

pt_4 = Point(demesh_3.Vertices)
pdecon = Deconstruct(Point=pt_4)  # -> XComponent, YComponent, ZComponent
bnd = Bounds(Numbers=pdecon.ZComponent)
dedomain = DeconstructDomain(Domain=bnd)  # -> Start, End
addition = Addition(A="0.01", B=dedomain.Start)
smaller_2 = SmallerThan(FirstNumber=pdecon.ZComponent, SecondNumber=addition)  # -> SmallerThan, OrEqualTo
cull_4 = CullPattern(List=pt_4, CullPattern=smaller_2.SmallerThan)
rdpoints = RemoveDuplicatePointsKaramba3D(Point=cull_4, LimitDistance=0.005)  # -> OutPoint, Info, Indexes

eim = ElasticIsotropicMaterialAlpaca4d(E="33000000000", v="0.20", rho="25")  # -> out, nDMaterial
# ---------- eim: Python ----------
"""
Create a nD Elastic Isotropic Material
-
    Args:
        name:
        E:
        G:
        v:
        rho:
    Returns:
        nDMaterial:
"""

ghenv.Component.Name = "Elastic Isotropic Material (Alpaca4d)"
ghenv.Component.NickName = 'EIM'
ghenv.Component.Message = "Elastic Isotropic (Alpaca4d)"


import sys
import Rhino.Geometry as rg
import Grasshopper as gh
import copy


## add alpaca install directory to system path

ghcompfolder = gh.Folders.DefaultAssemblyFolder
if ghcompfolder not in sys.path:
    sys.path.append(ghcompfolder)

try:
    from Alpaca4d import alpaca4d as alpaca
except:
    msg = "Cannot import Alpaca4d. Is the Alpaca4d folder available in " + ghcompfolder + "?"
    ghenv.Component.AddRuntimeMessage(gh.Kernel.GH_RuntimeMessageLevel.Error, msg)


checkData = True

if not E:
    checkData = False
    msg = "Input parameter E failed to collect data"
    ghenv.Component.AddRuntimeMessage(gh.Kernel.GH_RuntimeMessageLevel.Warning, msg)

if not G and not v:
    checkData = False
    msg = "Input parameter G or v failed to collect data"
    ghenv.Component.AddRuntimeMessage(gh.Kernel.GH_RuntimeMessageLevel.Warning, msg)

if not rho:
    checkData = False
    msg = "Input parameter rho failed to collect data"
    ghenv.Component.AddRuntimeMessage(gh.Kernel.GH_RuntimeMessageLevel.Warning, msg)

if checkData:
    nDMaterial = alpaca.ElasticIsotropic(name, E, G, rho, v)
# ---------- end eim ----------
quad = Quadrangulate(Mesh=mesh_breps.Mesh, Angle=0.03490658504, Ratio=0.875)  # -> Mesh, Count

# ---- group: Desired inclusion points
pt_5 = Point(pt_3)

# ----
pfs = PlateFiberAlpaca4d(thickness="0.15", nDMaterial=eim.nDMaterial)  # -> out, Section
# ---------- pfs: Python ----------
"""
Create a Plate Fiber Section
-
    Args:
        secName:
        thickness:
        nDMaterial:
    Returns:
        Section:
"""


import sys
import Rhino.Geometry as rg
import Grasshopper as gh
import copy

ghenv.Component.Name = "Plate Fiber (Alpaca4d)"
ghenv.Component.NickName = 'PFS'
ghenv.Component.Message = "Plate Fiber (Alpaca4d)"


## add alpaca install directory to system path

ghcompfolder = gh.Folders.DefaultAssemblyFolder
if ghcompfolder not in sys.path:
    sys.path.append(ghcompfolder)

try:
    from Alpaca4d import alpaca4d as alpaca
except:
    msg = "Cannot import Alpaca4d. Is the Alpaca4d folder available in " + ghcompfolder + "?"
    ghenv.Component.AddRuntimeMessage(gh.Kernel.GH_RuntimeMessageLevel.Error, msg)


checkData = True

if not thickness:
    checkData = False
    msg = "Input parameter thickness failed to collect data"
    ghenv.Component.AddRuntimeMessage(gh.Kernel.GH_RuntimeMessageLevel.Warning, msg)

if not nDMaterial:
    checkData = False
    msg = "Input parameter nDMaterial failed to collect data"
    ghenv.Component.AddRuntimeMessage(gh.Kernel.GH_RuntimeMessageLevel.Warning, msg)

if checkData:
    Section = alpaca.PlateFiberSection(secName, thickness, nDMaterial)
# ---------- end pfs ----------

# ---- group: Mesh to edit
mesh_3 = Mesh(quad.Mesh)

# ----
pfs_2 = PlateFiberAlpaca4d(thickness="0.30", nDMaterial=eim.nDMaterial)  # -> out, Section; same code as pfs

pdecon_2 = Deconstruct(Point=pt_5)  # -> XComponent, YComponent, ZComponent
larger = LargerThan(FirstNumber=pdecon_2.ZComponent, SecondNumber=1)  # -> LargerThan, OrEqualTo
dispatch = Dispatch(List=pt_5, DispatchPattern=larger.LargerThan)  # -> ListA, ListB
demesh_4 = DeconstructMesh(Mesh=mesh_3)  # -> Vertices, Faces, Colours, Normals
cp = ClosestPoint(Point=dispatch.ListA, Cloud=demesh_4.Vertices)  # -> ClosestPoint, CPIndex, Distance
replace = ReplaceItems(List=demesh_4.Vertices, Item=dispatch.ListA, Indices=cp.CPIndex, Wrap=False)
conmesh = ConstructMesh(Vertices=replace, Faces=demesh_4.Faces)

number_slider_4 = Slider(-5, range=-10..-5)
number_slider_5 = Slider(-5, range=-10..-5)
avr = Average(Input=rdpoints.OutPoint)
neg = Negative(Value=number_slider_4)
neg_2 = Negative(Value=number_slider_5)
dom = ConstructDomain(DomainStart=number_slider_4, DomainEnd=neg)
dom_2 = ConstructDomain(DomainStart=number_slider_5, DomainEnd=neg_2)
mitc4 = ShellMITC4Alpaca4d(Mesh=clean, Section=pfs.Section)  # -> out, Element; inputs Mesh: Mesh, Colour: Color
# ---------- mitc4: Python ----------
"""
Create a ShellMITC4 element
-
    Args:
        Mesh:
        Section:
        Colour:
    Returns:
        Element:
"""

ghenv.Component.Name = "Shell MITC4 (Alpaca4d)"
ghenv.Component.NickName = 'MITC4'
ghenv.Component.Message = "ShellMITC4 (Alpaca4d)"



import sys
import Rhino.Geometry as rg
import Grasshopper as gh
import copy
from System.Drawing import Color


## add alpaca install directory to system path

ghcompfolder = gh.Folders.DefaultAssemblyFolder
if ghcompfolder not in sys.path:
    sys.path.append(ghcompfolder)

try:
    from Alpaca4d import alpaca4d as alpaca
except:
    msg = "Cannot import Alpaca4d. Is the Alpaca4d folder available in " + ghcompfolder + "?"
    ghenv.Component.AddRuntimeMessage(gh.Kernel.GH_RuntimeMessageLevel.Error, msg)


checkData = True

if not Mesh:
    checkData = False
    msg = "Input parameter Mesh failed to collect data"
    ghenv.Component.AddRuntimeMessage(gh.Kernel.GH_RuntimeMessageLevel.Warning, msg)

if not Section:
    checkData = False
    msg = "Input parameter Section failed to collect data"
    ghenv.Component.AddRuntimeMessage(gh.Kernel.GH_RuntimeMessageLevel.Warning, msg)

if not Colour:
    Colour = Color.Blue


if checkData:
    
    Mesh.Unweld(0,True)
    explodedMesh = Mesh.ExplodeAtUnweldedEdges()
    if explodedMesh.Length > 0:
        Element = []
        for mesh in explodedMesh:
            if mesh.Vertices.Count == 4:
                Element.append(alpaca.ShellMITC4(mesh, copy.deepcopy(Section), Colour))
            elif mesh.Vertices.Count == 3:
                Element.append(alpaca.ShellNLDKGT(mesh, copy.deepcopy(Section), Colour))
    elif explodedMesh.Length == 0:
        if Mesh.Vertices.Count == 4:
                Element = alpaca.ShellMITC4(Mesh, copy.deepcopy(Section), Colour)
        elif Mesh.Vertices.Count == 3:
            Element = alpaca.ShellNLDKGT(Mesh, copy.deepcopy(Section), Colour)
# ---------- end mitc4 ----------
cts = ConstantTimeSeriesAlpaca4d()  # -> TimeSeries, Graph
# ---------- cts: Python ----------
"""
Create a Constant Time Series
-
    Args:
        tStart:
        tEnd:
        period:
        factor:
        shift:
    Returns:
        TimeSeries:
        Graph:
"""

ghenv.Component.Name = "Constant Time Series (Alpaca4d)"
ghenv.Component.NickName = 'CTS'
ghenv.Component.Message = "Constant Time Series (Alpaca4d)"


import sys
import Rhino.Geometry as rg
import Grasshopper as gh
import copy
import math


## add alpaca install directory to system path

ghcompfolder = gh.Folders.DefaultAssemblyFolder
if ghcompfolder not in sys.path:
    sys.path.append(ghcompfolder)

try:
    from Alpaca4d import alpaca4d as alpaca
except:
    msg = "Cannot import Alpaca4d. Is the Alpaca4d folder available in " + ghcompfolder + "?"
    ghenv.Component.AddRuntimeMessage(gh.Kernel.GH_RuntimeMessageLevel.Error, msg)

def ConstantSeries(x):
    return x



checkData = True

if not constantFactor:
    constantFactor = 1


if checkData:
    TimeSeries = alpaca.TimeSeriesConstant(constantFactor)
    
    Graph = []
    
    for x in range(10):
        Graph.append(ConstantSeries(constantFactor))
# ---------- end cts ----------
rectangle = Rectangle(Plane=avr, XSize=dom, YSize=dom_2, Radius=0)  # -> Rectangle, Length

# ---- group: Updated mesh
mesh_4 = Mesh(conmesh)

# ----
demesh_5 = DeconstructMesh(Mesh=mesh_4)  # -> Vertices, Faces, Colours, Normals
asd = ASDShellQ4Alpaca4d(Mesh=mesh_4, Section=pfs_2.Section, Colour=ColourSwatch(SwatchColor=RGB(255, 255, 255)))  # -> out, Element; inputs Mesh: Mesh, Colour: Color
# ---------- asd: Python ----------
"""
Create a ASDShellQ4 element
-
    Args:
        Mesh:
        Section:
        Colour:
    Returns:
        Element:
"""

ghenv.Component.Name = "ASD ShellQ4 (Alpaca4d)"
ghenv.Component.NickName = 'ASD'
ghenv.Component.Message = "ASD ShellQ4 (Alpaca4d)"



import sys
import Rhino.Geometry as rg
import Grasshopper as gh
import copy
from System.Drawing import Color


## add alpaca install directory to system path

ghcompfolder = gh.Folders.DefaultAssemblyFolder
if ghcompfolder not in sys.path:
    sys.path.append(ghcompfolder)

try:
    from Alpaca4d import alpaca4d as alpaca
except:
    msg = "Cannot import Alpaca4d. Is the Alpaca4d folder available in " + ghcompfolder + "?"
    ghenv.Component.AddRuntimeMessage(gh.Kernel.GH_RuntimeMessageLevel.Error, msg)


checkData = True

if not Mesh:
    checkData = False
    msg = "Input parameter Mesh failed to collect data"
    ghenv.Component.AddRuntimeMessage(gh.Kernel.GH_RuntimeMessageLevel.Warning, msg)

if not Section:
    checkData = False
    msg = "Input parameter Section failed to collect data"
    ghenv.Component.AddRuntimeMessage(gh.Kernel.GH_RuntimeMessageLevel.Warning, msg)

if not Colour:
    Colour = Color.Blue


if checkData:
    
    Mesh.Unweld(0,True)
    explodedMesh = Mesh.ExplodeAtUnweldedEdges()
    if explodedMesh.Length > 0:
        Element = []
        for mesh in explodedMesh:
            if mesh.Vertices.Count == 4:
                Element.append(alpaca.ASDShellQ4(mesh, copy.deepcopy(Section), Colour))
            elif mesh.Vertices.Count == 3:
                Element.append(alpaca.ShellNLDKGT(mesh, copy.deepcopy(Section), Colour))
    elif explodedMesh.Length == 0:
        if Mesh.Vertices.Count == 4:
                Element = alpaca.ASDShellQ4(Mesh, copy.deepcopy(Section), Colour)
        elif Mesh.Vertices.Count == 3:
            Element = alpaca.ShellNLDKGT(Mesh, copy.deepcopy(Section), Colour)
# ---------- end asd ----------
vec = VectorXYZ(XComponent=demesh_5.Vertices, YComponent=0, ZComponent="-1000")  # -> Vector, Length
pl = PointLoadAlpaca4d(Pos=demesh_5.Vertices, Force=vec.Vector, TimeSeries=cts.TimeSeries)  # -> out, Load; inputs Pos: Point3d, Force: Vector3d, Moment: Vector3d
# ---------- pl: Python ----------
"""
Create a Point Load
-
    Args:
        Pos:
        Force:
        Moment:
        TimeSeries:
    Returns:
        PointLoad:
"""

ghenv.Component.Name = "Point Load (Alpaca4d)"
ghenv.Component.NickName = 'PL'
ghenv.Component.Message = "Point Load (Alpaca4d)"



import sys
import Rhino.Geometry as rg
import Grasshopper as gh
import copy


## add alpaca install directory to system path

ghcompfolder = gh.Folders.DefaultAssemblyFolder
if ghcompfolder not in sys.path:
    sys.path.append(ghcompfolder)

try:
    from Alpaca4d import alpaca4d as alpaca
except:
    msg = "Cannot import Alpaca4d. Is the Alpaca4d folder available in " + ghcompfolder + "?"
    ghenv.Component.AddRuntimeMessage(gh.Kernel.GH_RuntimeMessageLevel.Error, msg)


checkData = True

if not Pos:
    checkData = False
    msg = "Input parameter Pos failed to collect data"
    ghenv.Component.AddRuntimeMessage(gh.Kernel.GH_RuntimeMessageLevel.Warning, msg)

if not Force:
    Force = rg.Vector3d(0,0,0)

if not Moment:
    Moment = rg.Vector3d(0,0,0)

if not TimeSeries:
    checkData = False
    msg = "Input parameter TimeSeries failed to collect data"
    ghenv.Component.AddRuntimeMessage(gh.Kernel.GH_RuntimeMessageLevel.Warning, msg)


if checkData:
    Load = alpaca.PointLoad(Pos, Force, Moment, TimeSeries)
# ---------- end pl ----------
lng = ListLength(List=rdpoints.OutPoint)
repeat = RepeatData(Data="1.00", Length=lng)
ilinearquad = ILinearQuad(
    MinimumSize="1.00",
    MaximunSize="6",
    CurvatureAdapt=False,
    MininimumElements=6,
    SmoothingSteps=10,
    Massive_Refinement=False)
ipointconstraint = IPointConstraint(Point=rdpoints.OutPoint, Sizes=repeat)
ipatchplanar = IPatchPlanar(OuterBoundary=rectangle.Rectangle, IConstraints=ipointconstraint, ISettings=ilinearquad)  # -> IMesh, Entities, Info
ideconstructmesh = IDeconstructMesh(IMesh=ipatchplanar.IMesh)  # -> IVertices, VertexKeys, IElements, IKeysE, SiblingHalfFacets, VertexToHalfFacet
ideconstructelement = IDeconstructElement(IMesh=ipatchplanar.IMesh, IElement=ideconstructmesh.IKeysE)  # -> Vertices, Dimension, HalfFacet, SiblingHalfFacet, Type
subtraction = Subtraction(A=ideconstructelement.Vertices, B=1)
item_2 = ListItem(List=subtraction, Index=0, Wrap=True)  # -> Item, Item1, Item2, Item3
quad_2 = MeshQuad(CornerA=item_2.Item, CornerB=item_2.Item1, CornerC=item_2.Item2, CornerD=item_2.Item3)
conmesh_2 = ConstructMesh(Vertices=ideconstructmesh.IVertices, Faces=flatten(quad_2))
series = Series(Start=0, Step=Slider(0.2, range=0.2..1), Count="5")
neg_3 = Negative(Value=series)
Z_2 = UnitZ(Factor=neg_3)
move_3 = Move(Geometry=conmesh_2, Motion=Z_2)  # -> Geometry, Transform
mstb = MeshSeriesToBrickAlpaca4d(MeshSeries=move_3.Geometry)  # -> simplify(flatten(Brick)); inputs MeshSeries: list of Mesh
# ---------- mstb: Python ----------
"""Generate a Brick element from a list of mesh .
    the faces of the mesh '0' will be connected with the faces of the meshes '1' generating a brick element ( cube ).
    Attention : Each mesh in the list must have the same number of faces.
    Inputs:
        MeshSeries: quadMesh list with the same number of subdivisions .
    Output:
        Brick: Brick element --> Mesh with 6 faces and 8 nodes.
       """
import Rhino.Geometry as rg
import Grasshopper as gh

def MeshToShell(Mesh):
    
    Mesh.Unweld(0, True)
    mesh = Mesh.ExplodeAtUnweldedEdges()
    #print( len(mesh) )
    newMesh = []
    elementType = []
    for explodedMesh in mesh:
        newMesh.append(explodedMesh)
    return newMesh 

def brick( MeshList ):
    meshExpl = []
    Vertix = []
    elementType = []
    solid = []
    a = rg.Mesh.DuplicateMesh( MeshList[0] ) #.Unweld(0, True)
    a.Unweld(0, True)
    b = a.ExplodeAtUnweldedEdges()
    if len( b ) > 0 :
        for Mesh in MeshList:
            shellWrapper = MeshToShell(Mesh)
            meshExpl.append( shellWrapper )
        for index1 in range(0, len(MeshList)-1):
            for index2 in range(0, len(meshExpl[0])):
                if meshExpl[ index1 ][ index2 ].Vertices.Count == 4:
                    
                    elementType.append("stdBrick")
                    vertix1 = meshExpl[ index1 ][ index2 ].Vertices[0]
                    vertix2 = meshExpl[ index1 ][ index2 ].Vertices[1]
                    vertix3 = meshExpl[ index1 ][ index2 ].Vertices[2]
                    vertix4 = meshExpl[ index1 ][ index2 ].Vertices[3]
                    vertix5 = meshExpl[index1 + 1 ][ index2].Vertices[0]
                    vertix6 = meshExpl[index1 + 1 ][ index2].Vertices[1]
                    vertix7 = meshExpl[index1 + 1 ][ index2].Vertices[2]
                    vertix8 = meshExpl[index1 + 1 ][ index2].Vertices[3]
                    
                    vertix = [ vertix1, vertix2, vertix3, vertix4,
                    vertix5, vertix6, vertix7, vertix8 ]
                    
                    ele = rg.Mesh()
                    
                    ele.Vertices.Add( vertix1 ) # 0 
                    ele.Vertices.Add( vertix2 ) # 1
                    ele.Vertices.Add( vertix3 ) # 2
                    ele.Vertices.Add( vertix4 ) # 3
                    ele.Vertices.Add( vertix5 ) # 4
                    ele.Vertices.Add( vertix6 ) # 5
                    ele.Vertices.Add( vertix7 ) # 6
                    ele.Vertices.Add( vertix8 ) # 7
                    
                    ele.Faces.AddFace(0, 1, 2, 3) # 0
                    ele.Faces.AddFace(4, 5, 6, 7) # 1
                    ele.Faces.AddFace(0, 1, 5, 4) # 2
                    ele.Faces.AddFace(3, 2, 6, 7) # 3
                    ele.Faces.AddFace(1, 5, 6, 2) # 4
                    ele.Faces.AddFace(0, 4, 7, 3) # 5
                solid.append(ele)
                #ele.IsClosed()
                    
    else:
        for index1 in range(0, len(MeshList)-1):
            elementType.append("stdBrick")
            vertix1 = MeshList[ index1 ].Vertices[0]
            vertix2 = MeshList[ index1 ].Vertices[1]
            vertix3 = MeshList[ index1 ].Vertices[2]
            vertix4 = MeshList[ index1 ].Vertices[3]
            vertix5 = MeshList[index1 + 1 ].Vertices[0]
            vertix6 = MeshList[index1 + 1 ].Vertices[1]
            vertix7 = MeshList[index1 + 1 ].Vertices[2]
            vertix8 = MeshList[index1 + 1 ].Vertices[3]
            
            vertix = [ vertix1, vertix2, vertix3, vertix4,
            vertix5, vertix6, vertix7, vertix8 ]
            
            ele = rg.Mesh()
            
            ele.Vertices.Add( vertix1 ) # 0 
            ele.Vertices.Add( vertix2 ) # 1
            ele.Vertices.Add( vertix3 ) # 2
            ele.Vertices.Add( vertix4 ) # 3
            ele.Vertices.Add( vertix5 ) # 4
            ele.Vertices.Add( vertix6 ) # 5
            ele.Vertices.Add( vertix7 ) # 6
            ele.Vertices.Add( vertix8 ) # 7
            
            ele.Faces.AddFace(0, 1, 2, 3) # 0
            ele.Faces.AddFace(4, 5, 6, 7) # 1
            ele.Faces.AddFace(0, 1, 5, 4) # 2
            ele.Faces.AddFace(3, 2, 6, 7) # 3
            ele.Faces.AddFace(1, 5, 6, 2) # 4
            ele.Faces.AddFace(0, 4, 7, 3) # 5
            
            solid.append(ele)
            '''
            else :
                elementType.append(["FourNodeTetrahedron"]*3)
                
                if meshExpl[ index1 ][ index2 ].Vertices[0] == meshExpl[index1 + 1 ][ index2].Vertices[0] :
                    vertix1 = meshExpl[ index1 ][ index2 ].Vertices[0]
                    vertix2 = meshExpl[ index1 ][ index2 ].Vertices[1]
                    vertix3 = meshExpl[ index1 ][ index2 ].Vertices[2]
                    vertix4 = meshExpl[index1 + 1 ][ index2].Vertices[1]
                    vertix5 = meshExpl[index1 + 1 ][ index2].Vertices[2]
                    
                    vertixEle1 = [ vertix1, vertix2, vertix3, vertix4 ]
                    vertixEle2 = [ vertix1, vertix2, vertix3, vertix2 ]
                    
                    ele1 = rg.Mesh() # Tetrahedron 1
                    ele2 = rg.Mesh() # Tetrahedron 2
                    
                    ele1.Vertices.Add( vertix1 ) # 0 
                    ele1.Vertices.Add( vertix2 ) # 1
                    ele1.Vertices.Add( vertix3 ) # 2 
                    ele1.Vertices.Add( vertix4 ) # 3 
                    
                    ele1.VertexColors.Add(color)
                    ele1.VertexColors.Add(color)
                    ele1.VertexColors.Add(color)
                    ele1.VertexColors.Add(color)
                    
                    ele2.Vertices.Add( vertix1 ) # 0 
                    ele2.Vertices.Add( vertix2 ) # 1 
                    ele2.Vertices.Add( vertix3 ) # 2 
                    ele2.Vertices.Add( vertix2 ) # 3
    
                    ele2.VertexColors.Add(color)
                    ele2.VertexColors.Add(color)
                    ele2.VertexColors.Add(color)
                    ele2.VertexColors.Add(color)
                    
                    ele1.Faces.AddFace(0, 1, 4 ) # 0
                    ele1.Faces.AddFace(0, 1, 3 ) # 1
                    ele1.Faces.AddFace(0, 4, 3 ) # 2
                    ele1.Faces.AddFace(1, 3, 4 ) # 3
                    
                    ele2.Faces.AddFace(0, 1, 3 ) # 0
                    ele2.Faces.AddFace(0, 1, 2 ) # 1
                    ele2.Faces.AddFace(1, 2, 3 ) # 2
                    ele2.Faces.AddFace(0, 2, 3 ) # 3
                    
                    ele = [ ele1, ele2 ]
                    
                else :
                
                    vertix1 = meshExpl[ index1 ][ index2 ].Vertices[0]
                    vertix2 = meshExpl[ index1 ][ index2 ].Vertices[1]
                    vertix3 = meshExpl[ index1 ][ index2 ].Vertices[2]
                    vertix4 = meshExpl[index1 + 1 ][ index2].Vertices[0]
                    vertix5 = meshExpl[index1 + 1 ][ index2].Vertices[1]
                    vertix6 = meshExpl[index1 + 1 ][ index2].Vertices[2]
                    
                    vertixEle1 = [ vertix1, vertix2, vertix3, vertix6 ]
                    vertixEle2 = [ vertix4, vertix5, vertix6, vertix1 ]
                    vertixEle3 = [ vertix5, vertix6, vertix2, vertix1 ]
                    
                    vertix = [ vertixEle1, vertixEle2, vertixEle3 ]
                    
                    ele1 = rg.Mesh() # Tetrahedron 1
                    ele2 = rg.Mesh() # Tetrahedron 2
                    ele3 = rg.Mesh() # Tetrahedron 3
                    
                    ele1.Vertices.Add( vertix1 ) # 0 
                    ele1.Vertices.Add( vertix2 ) # 1
                    ele1.Vertices.Add( vertix3 ) # 2 
                    ele1.Vertices.Add( vertix6 ) # 3 
                    
                    ele1.VertexColors.Add(color)
                    ele1.VertexColors.Add(color)
                    ele1.VertexColors.Add(color)
                    ele1.VertexColors.Add(color)
                    
                    ele2.Vertices.Add( vertix4 ) # 0 
                    ele2.Vertices.Add( vertix5 ) # 1 
                    ele2.Vertices.Add( vertix6 ) # 2 
                    ele2.Vertices.Add( vertix1 ) # 3
    
                    ele2.VertexColors.Add(color)
                    ele2.VertexColors.Add(color)
                    ele2.VertexColors.Add(color)
                    ele2.VertexColors.Add(color)
                    
                    ele3.Vertices.Add( vertix5 ) # 0 
                    ele3.Vertices.Add( vertix6 ) # 1 
                    ele3.Vertices.Add( vertix2 ) # 2 
                    ele3.Vertices.Add( vertix1 ) # 3
                    
                    ele3.VertexColors.Add(color)
                    ele3.VertexColors.Add(color)
                    ele3.VertexColors.Add(color)
                    ele3.VertexColors.Add(color)
                    
                    ele1.Faces.AddFace(0, 1, 2 ) # 0
                    ele1.Faces.AddFace(0, 3, 1 ) # 1
                    ele1.Faces.AddFace(0, 3, 2 ) # 2
                    ele1.Faces.AddFace(1, 3, 2 ) # 3
                    
                    ele2.Faces.AddFace(0, 1, 2 ) # 0
                    ele2.Faces.AddFace(0, 3, 1 ) # 1
                    ele2.Faces.AddFace(0, 3, 2 ) # 2
                    ele2.Faces.AddFace(1, 3, 2 ) # 3
                    
                    ele3.Faces.AddFace(0, 1, 2 ) # 0
                    ele3.Faces.AddFace(0, 3, 1 ) # 1
                    ele3.Faces.AddFace(0, 3, 2 ) # 2
                    ele3.Faces.AddFace(1, 3, 2 ) # 3
                    
                    ele = [ ele1, ele2, ele3 ]
            
            solid.append(ele)
            Vertix.append( vertix )
            '''
    return solid

checkData = True

if not MeshSeries or len(MeshSeries) == 1 :  #is not None:
    checkData = False
    msg = "input 'MeshSeries' failed to collect data"
    ghenv.Component.AddRuntimeMessage( gh.Kernel.GH_RuntimeMessageLevel.Warning, msg )

if checkData != False:
    Brick= brick( MeshSeries )
# ---------- end mstb ----------
clean_2 = CombineClean(Meshes=mstb)
demesh_6 = DeconstructMesh(Mesh=clean_2)  # -> Vertices, Faces, Colours, Normals
wbnaked = WeaverbirdsNakedBoundary(MeshClosedPolylines=move_3.Geometry)
explode_3 = Explode(Curve=wbnaked, Recursive=True)  # -> Segments, Vertices

pt_6 = Point(demesh_6.Vertices)
pdecon_3 = Deconstruct(Point=pt_6)  # -> XComponent, YComponent, ZComponent
bnd_2 = Bounds(Numbers=pdecon_3.ZComponent)
dedomain_2 = DeconstructDomain(Domain=bnd_2)  # -> Start, End
addition_2 = Addition(A="0.01", B=dedomain_2.Start)
smaller_3 = SmallerThan(FirstNumber=pdecon_3.ZComponent, SecondNumber=addition_2)  # -> SmallerThan, OrEqualTo
cull_5 = CullPattern(List=pt_6, CullPattern=smaller_3.SmallerThan)
rdpoints_2 = RemoveDuplicatePointsKaramba3D(Point=flatten([cull_5, explode_3.Vertices]), LimitDistance=0.005)  # -> OutPoint, Info, Indexes

eim_2 = ElasticIsotropicMaterialAlpaca4d(E="3300000000", v="0.20", rho="15")  # -> out, nDMaterial; same code as eim
toggle = BooleanToggle(True)
stdb = StdBrickAlpaca4d(Brick=mstb, nDMaterial=eim_2.nDMaterial, Colour=ColourSwatch(SwatchColor=RGB(255, 0, 255)))  # -> out, Element; inputs Brick: Mesh, Colour: Color
# ---------- stdb: Python ----------
"""
Create a Standard Brick (stdBrick)
-
    Args:
        Brick:
        nDMaterial:
        Colour:
    Returns:
        Element:
"""

ghenv.Component.Name = "std Brick (Alpaca4d)"
ghenv.Component.NickName = 'STDB'
ghenv.Component.Message = "std Brick (Alpaca4d)"


import sys
import Rhino.Geometry as rg
import Grasshopper as gh
import copy
from System.Drawing import Color


## add alpaca install directory to system path

ghcompfolder = gh.Folders.DefaultAssemblyFolder
if ghcompfolder not in sys.path:
    sys.path.append(ghcompfolder)

try:
    from Alpaca4d import alpaca4d as alpaca
    from Alpaca4d import alpaca4dUtil as alpacaUtil
except:
    msg = "Cannot import Alpaca4d. Is the Alpaca4d folder available in " + ghcompfolder + "?"
    ghenv.Component.AddRuntimeMessage(gh.Kernel.GH_RuntimeMessageLevel.Error, msg)


checkData = True

if not Brick:
    checkData = False
    msg = "Input parameter Brick failed to collect data"
    ghenv.Component.AddRuntimeMessage(gh.Kernel.GH_RuntimeMessageLevel.Warning, msg)

if not nDMaterial:
    checkData = False
    msg = "Input parameter nDMaterial failed to collect data"
    ghenv.Component.AddRuntimeMessage(gh.Kernel.GH_RuntimeMessageLevel.Warning, msg)

if not Colour:
    Colour = Color.DarkOrange


if checkData:
    Brick = alpacaUtil.cleanHexahedron(Brick)
    Element = alpaca.stdBrick(Brick,copy.deepcopy(nDMaterial), Colour)
# ---------- end stdb ----------
support = SupportAlpaca4d(Pos=rdpoints_2.OutPoint, Tx=toggle, Ty=toggle, Tz=toggle, Rx=toggle, Ry=toggle, Rz=toggle)  # -> Support; inputs Pos: Point3d, Tx: Boolean, Ty: Boolean, Tz: Boolean, Rx: Boolean, Ry: Boolean, Rz: Boolean
# ---------- support: Python ----------
"""
Create a support
-
    Args:
        Pos:
        Tx:
        Ty:
        Tz:
        Rx:
        Ry:
    Returns:
        Support:
"""

ghenv.Component.Name = "Support (Alpaca4d)"
ghenv.Component.NickName = 'Support'
ghenv.Component.Message = "Support (Alpaca4d)"


import sys
import Rhino.Geometry as rg
import Grasshopper as gh


## add alpaca install directory to system path

ghcompfolder = gh.Folders.DefaultAssemblyFolder
if ghcompfolder not in sys.path:
    sys.path.append(ghcompfolder)

try:
    from Alpaca4d import alpaca4d as alpaca
except:
    msg = "Cannot import Alpaca4d. Is the Alpaca4d folder available in " + ghcompfolder + "?"
    ghenv.Component.AddRuntimeMessage(gh.Kernel.GH_RuntimeMessageLevel.Error, msg)

checkData = True


if not Pos:
    checkData = False
    msg = "Input parameter Pos failed to collect data"
    ghenv.Component.AddRuntimeMessage(gh.Kernel.GH_RuntimeMessageLevel.Warning, msg)

if checkData:
    Support = alpaca.Support(Pos, Tx, Ty, Tz, Rx, Ry, Rz)
# ---------- end support ----------
cts_2 = ConstantTimeSeriesAlpaca4d()  # -> TimeSeries, Graph; disabled; same code as cts
panel = Panel("1000000")  # disabled
gl = GravityLoadAlpaca4d(GravityFactor=panel, TimeSeries=cts_2.TimeSeries)  # -> out, Load; disabled
# ---------- gl: Python ----------
"""
Create Gravity Load
-
    Args:
        Pos:
        Force:
        Moment:
        TimeSeries:
    Returns:
        PointLoad:
"""

ghenv.Component.Name = "Gravity Load (Alpaca4d)"
ghenv.Component.NickName = 'GL'
ghenv.Component.Message = "Gravity Load (Alpaca4d)"



import sys
import Rhino.Geometry as rg
import Grasshopper as gh
import copy


## add alpaca install directory to system path

ghcompfolder = gh.Folders.DefaultAssemblyFolder
if ghcompfolder not in sys.path:
    sys.path.append(ghcompfolder)

try:
    from Alpaca4d import alpaca4d as alpaca
except:
    msg = "Cannot import Alpaca4d. Is the Alpaca4d folder available in " + ghcompfolder + "?"
    ghenv.Component.AddRuntimeMessage(gh.Kernel.GH_RuntimeMessageLevel.Error, msg)

if not TimeSeries:
    TimeSeries = alpaca.TimeSeriesConstant(1)

Load = alpaca.GravityLoad(GravityFactor, TimeSeries)
# ---------- end gl ----------
gl_2 = GravityLoadAlpaca4d(GravityFactor=1)  # -> out, Load; same code as gl
am = AssembleModelAlpaca4d(Element=flatten([asd.Element, mitc4.Element, stdb.Element]), Support=support, Load=gl_2.Load)  # -> out, AlpacaModel, Mass; inputs Element: list, Support: list, Load: list, Constraint: list
# ---------- am: Python ----------
"""
Create a FEA Model
-
    Args:
        Element:
        Support:
        Load:
        Constraint:
    Returns:
        AlpacaModel:
"""

ghenv.Component.Name = "Assemble Model (Alpaca4d)"
ghenv.Component.NickName = 'AM'
ghenv.Component.Message = "Assemble Model (Alpaca4d)"




import os
from Alpaca4d import alpaca4d as alpaca
import ghpythonlib.treehelpers as th
import Rhino.Geometry as rg
import Rhino.Collections as rc
import rhinoscriptsyntax as rs
from collections import defaultdict, OrderedDict
import copy
import time



FolderPath = rs.DocumentPath()
os.chdir(FolderPath)

# create the object model
AlpacaModel = alpaca.Model()


start = time.clock()
#subdivide element per type

for element in Element:
    if element.type == "Beam":
        AlpacaModel.beams.append(element)
    elif element.type == "Shell":
        AlpacaModel.shells.append(element)
    elif element.type == "Brick":
        AlpacaModel.bricks.append(element)

end = time.clock() - start
print("time to subdivide element {}".format(end))
start = time.clock()

# create a list of unique point
# need to add the rigid constraint

AlpacaModel.getuniquePoints(AlpacaModel.beams, AlpacaModel.shells, AlpacaModel.bricks, AlpacaModel.constraints)


end = time.clock() - start
print("time to get uniquepoints {}".format(end))
start = time.clock()


#############
# create node and assign to object
#############

if AlpacaModel.uniquePointsThreeNDF:
    AlpacaModel.py.append(alpaca.Model.write3ndf_tcl())
    for point in AlpacaModel.uniquePointsThreeNDF:
        node = alpaca.Node(point)
        node.ndf = 3
        node.setNodeTag(AlpacaModel)
        AlpacaModel.nodes.append( node )
    
        AlpacaModel.py.append(node.write_tcl())


if AlpacaModel.uniquePointsSixNDF:
    AlpacaModel.py.append(alpaca.Model.write6ndf_tcl())
    for point in AlpacaModel.uniquePointsSixNDF:
        node = alpaca.Node(point)
        node.ndf = 6
        node.setNodeTag(AlpacaModel)
        AlpacaModel.nodes.append( node )
     
        AlpacaModel.py.append(node.write_tcl())



end = time.clock() - start
print("time to create node and assign tag {}".format(end))
start = time.clock()


#################
# create supports
#################

for supportNode in Support:
    
    # if the list is empty, skip this operation
    if AlpacaModel.uniquePointsThreeNDF:
        closestPointInThreeNDF = rc.Point3dList.ClosestPointInList(AlpacaModel.uniquePointsThreeNDF, supportNode.Pos)
        if supportNode.Pos.DistanceTo(closestPointInThreeNDF) < 0.001:
            #print("I am in 3ndf")
            supportNode.ndf = 3
            AlpacaModel.threeNDFModel.append(supportNode)
            supportNode.setNodeTag(AlpacaModel)
    
    if AlpacaModel.uniquePointsSixNDF:
        closestPointInSixNDF = rc.Point3dList.ClosestPointInList(AlpacaModel.uniquePointsSixNDF, supportNode.Pos)
        if supportNode.Pos.DistanceTo(closestPointInSixNDF) < 0.001:
            supportNode.ndf = 6
            AlpacaModel.sixNDFModel.append(supportNode)
            supportNode.setNodeTag(AlpacaModel)
    
    
    AlpacaModel.supports.append(supportNode)
    AlpacaModel.py.append(supportNode.write_tcl())


end = time.clock() - start
print("time to create support and assign tag {}".format(end))
start = time.clock()


####################
# create constraints
####################


for constraint in Constraint:
    constraint.setNodeTag(AlpacaModel)
    AlpacaModel.constraints.append(constraint)

####################
# create equalDOF when the model has 3df and 6df together
####################


end = time.clock() - start
print("time to create constraint and assign tag {}".format(end))
start = time.clock()


Id = []
IdB = []

def SearchCallback(sender, e):
    Id.Add(e.Id)
    IdB.Add(e.IdB)



lenThreeNDF = len(AlpacaModel.uniquePointsThreeNDF)
lenSixNDF = len(AlpacaModel.uniquePointsSixNDF)


if not(lenThreeNDF == 0 or lenSixNDF == 0):
    print("brick and beam together")
    rg.RTree.SearchOverlaps(AlpacaModel.RTreeCloudPointThreeNDF, AlpacaModel.RTreeCloudPointSixNDF, 0.001, SearchCallback)
    
    for i,j in zip(Id, IdB):
        print(i,j)
        node_i = AlpacaModel.uniquePointsThreeNDF[i]
        node_j = AlpacaModel.uniquePointsSixNDF[j]
        
        #index_i = AlpacaModel.cloudPoint.ClosestPoint(node_i) + 1
        #index_j = AlpacaModel.cloudPoint.ClosestPoint(node_j) + 1
        
        equalConstraint = alpaca.EqualDOF(node_i, node_j, True, True, True, False, False, False)
        equalConstraint.masterNodeTag = AlpacaModel.cloudPointThreeNDF.ClosestPoint(node_i) + 1
        equalConstraint.slaveNodesTag = AlpacaModel.cloudPointSixNDF.ClosestPoint(node_j) + 1 + len(AlpacaModel.uniquePointsThreeNDF)
        AlpacaModel.py.append(equalConstraint.write_tcl())



end = time.clock() - start
print("time to find common points between 3ndf and 6ndf {}".format(end))
start = time.clock()


# write py file


# assign tag and node Index to element and shell
for index, element in enumerate(Element,1):
    element.setTopologyRTree(AlpacaModel)
    element.eleTag = index
    element.setTags()



end = time.clock() - start
print("time to assign tags for the elements {}".format(end))
start = time.clock()



Mass = 0
IsGravity = False

for item in Load:
    if item.type == "Gravity Load":
        IsGravity = True
        GravityLoad = item
    if item.type == "PointLoad":
        AlpacaModel.loads.append(item)


for item in Element:
    if item.type == "Beam":
        length = item.Crv.GetLength()
        Mass += (item.massDens * length)
        if IsGravity:
            gravityPointLoad = alpaca.PointLoad(item.Crv.PointAtStart, rg.Vector3d(0,0, -(item.massDens * length / 2)) * GravityLoad.GravityFactor, rg.Vector3d(0,0,0), GravityLoad.TimeSeries)
            #print( -(item.massDens * length / 2))
            AlpacaModel.loads.append(gravityPointLoad)
    if item.type == "Shell":
        meshArea = rg.AreaMassProperties.Compute(item.Mesh).Area
        areaDensity = item.CrossSection.height * item.CrossSection.material.rho
        Mass += areaDensity * meshArea
        if IsGravity:
            for vertex in item.Mesh.Vertices.ToPoint3dArray():
                gravityPointLoad = alpaca.PointLoad(vertex, rg.Vector3d(0,0, -(areaDensity * meshArea/ len(item.Mesh.Vertices))) * GravityLoad.GravityFactor, rg.Vector3d(0,0,0), GravityLoad.TimeSeries)
                AlpacaModel.loads.append(gravityPointLoad)
    if item.type == "Brick":
        #print(type(item.Mesh))
        meshVolume = rg.VolumeMassProperties.Compute(item.Mesh).Volume
        density = item.material.rho 
        Mass += density * meshVolume
        if IsGravity:
            for vertex in item.Mesh.Vertices.ToPoint3dArray():
                gravityPointLoad = alpaca.PointLoad(vertex, rg.Vector3d(0,0, -(density * meshVolume / len(item.Mesh.Vertices))) * GravityLoad.GravityFactor, rg.Vector3d(0,0,0), GravityLoad.TimeSeries)
                #print(len(item.Mesh.Vertices))
                #print(density)
                # volume can be zero if mesh faces are not properly rotated
                #print(meshVolume)
                #print(-(density * meshVolume / len(item.Mesh.Vertices)))
                AlpacaModel.loads.append(gravityPointLoad)

#print(AlpacaModel.loads)
## load

for item in AlpacaModel.loads:
    item.setNodeTag(AlpacaModel)

#print(AlpacaModel.loads)

for item in AlpacaModel.beams:
    AlpacaModel.py.append(item.write_tcl())

for item in AlpacaModel.shells:
    AlpacaModel.py.append(item.write_tcl())

for item in AlpacaModel.bricks:
    AlpacaModel.py.append(item.write_tcl())


for item in Constraint:
    AlpacaModel.py.append(item.write_tcl())


timeSeriesDict = alpaca.TimeSeries.getTimeSeries(AlpacaModel.loads)[1]
AlpacaModel.py.append(alpaca.PointLoad.write_tcl(timeSeriesDict,AlpacaModel))
# ---------- end am ----------
as = AnalysisSettingsAlpaca4d(Algorithm="KrylovNewton", AnalysisSteps="1")  # -> out, Settings
# ---------- as: Python ----------
"""
Create Analysis settings
-
    Args:
        Constraint: 'Plain', 'Transformation'. Default is 'Transformation'.
        Numberer: 'RCM', 'AMD', 'Plain'. Default is 'RCM'.
        System: 'BandGen', 'BandSPD', 'ProfileSPD', 'SuperLU', 'UmfPack', 'FullGeneral', 'SparseSYM'. Default is 'BandSPD'.
        Test: Feature not implemented. Please contact alpaca4d@gmail.com 
        Algorithm: 'Linear', 'Newton', 'NewtonLineSearch', 'ModifiedNewton', 'KrylovNewton', 'SecantNewton', 'BFGS', 'Broyden'. Default is 'Linear'.
        Integrator: Default is LoadControl.
        AnalysisType: 'Static', 'Transient'. Default is 'Static'.
        AnalyesSteps:
    Returns:
        Analysis:
"""

import sys
import os


import clr
import clrtype
import Rhino.Geometry as rg
import rhinoscriptsyntax as rs
import Grasshopper as gh
import copy
import ghpythonlib.treehelpers as th


ghenv.Component.Name = "Analysis settings (Alpaca4d)"
ghenv.Component.NickName = 'AS'
ghenv.Component.Message = "Analysis settings \n(Alpaca4d)"



from Alpaca4d import alpaca4d as alpaca

checkData = True


# default Value
Constraint = 'Transformation' if Constraint is None else Constraint
ConstraintList = ['Plain', 'Transformation']

for item in ConstraintList:
    if Constraint.lower() == item.lower():
        print(item)
        Constraint = item


# default Value
Numberer = 'RCM' if Numberer is None else Numberer
NumbererList = ['RCM', 'AMD', 'Plain', 'ParallelPlain', 'ParallelRCM']

for i,item in enumerate(NumbererList):
    if Numberer.lower() == item.lower():
        Numberer = item



# default Value
System = 'BandSPD' if System is None else System
SystemList = ['BandGen', 'BandSPD', 'ProfileSPD', 'SuperLU', 'UmfPack', 'FullGeneral', 'SparseSYM']

for i,item in enumerate(SystemList):
    if System.lower() == item.lower():
        System = item


# default Test
Test = 'NormDispIncr 1.0e-6 12 5' if Test is None else Test




# default Value
Algorithm = 'Linear' if Algorithm is None else Algorithm
AlgorithmList = ['Linear', 'Newton', 'NewtonLineSearch', 'ModifiedNewton', 'KrylovNewton', 'SecantNewton', 'BFGS', 'Broyden']

for i,item in enumerate(AlgorithmList):
    if Algorithm.lower() == item.lower():
        Algorithm = item


# default Value
AnalysisType = 'Static' if AnalysisType is None else AnalysisType
AnalysisTypeList = ['Static', 'Transient']

for item in AnalysisTypeList:
    if AnalysisType.lower() == item.lower():
        AnalysisType = item


## Define Integrator
if AnalysisType == "Static":
    Integrator = "LoadControl 1.0" if Integrator is None else Integrator
elif AnalysisType == "Transien":
    Integrator = "Newmark 0.5 0.25" if Integrator is None else Integrator



if not AnalysisSteps:
    checkData = False
    msg = "Input parameter AnalysisSteps failed to collect data"
    ghenv.Component.AddRuntimeMessage(gh.Kernel.GH_RuntimeMessageLevel.Warning, msg)


if checkData:
    Settings = alpaca.Analysis(Constraint, Numberer,System,Test,Algorithm,Integrator,AnalysisType, AnalysisSteps)
    print(Settings.write_tcl())
# ---------- end as ----------
vm = ViewModelAlpaca4d(AlpacaModel=am.AlpacaModel, type=Toggle(True), load=Toggle(False))  # inputs type: Boolean, nodeTag: Boolean, eleTag: Boolean, localAxis: Boolean, support: Boolean, load: Boolean
# ---------- vm: Python ----------
"""View structural Model
    Inputs:
        AlpacaModel: Output of Assemble Model.
        type: Style of visualize Model 
Default: Visualize the stick Model
True: Visualize the extrude Model
        nodeTag: 
True: Visualize tag nodes
        eleTag: 
True: Visualize tag elements 
        LocalAxes:
True: Visualize local Axis of elements 
        Support: 
True: Visualize support type
        Load: 
True: Visualize load
"""


from ghpythonlib.componentbase import executingcomponent as component
import Grasshopper, GhPython
import System
import ghpythonlib.components as ghcomp

import Rhino as rc
import rhinoscriptsyntax as rs
import sys
import Rhino.Geometry as rg
import Grasshopper as gh
import copy

ghenv.Component.Name = "View Model (Alpaca4d)"
ghenv.Component.NickName = 'VM'
ghenv.Component.Message = "View Model (Alpaca4d)"

ghcompfolder = gh.Folders.DefaultAssemblyFolder
if ghcompfolder not in sys.path:
    sys.path.append(ghcompfolder)
try:
    from Alpaca4d import alpaca4dView as alpacaView
except:
    msg = "Cannot import Alpaca4d. Is the Alpaca4d folder available in " + ghcompfolder + "?"
    ghenv.Component.AddRuntimeMessage(gh.Kernel.GH_RuntimeMessageLevel.Error, msg)

checkData = True

class MyComponent(component):
    
    def RunScript(self, AlpacaModel, type, nodeTag, eleTag, localAxis, support, load):
        
        
        self.ModelBeam = []
        self.ModelShell = []
        self.ModelBrick = []
        self.Nodes = []
        self.TagEle = []
        self.localAxis = []
        self.solidSupport = []
        self.viewLoad = []
        
        if not AlpacaModel:
            checkData = False
            msg = "Input parameter AlpacaModel failed to collect data"
            ghenv.Component.AddRuntimeMessage(gh.Kernel.GH_RuntimeMessageLevel.Warning, msg)
        else:
            self.type = type
            
            ## add alpaca install directory to system path
            
            self.ModelBeam = alpacaView.ViewBeam( AlpacaModel, type)
            self.ModelShell = alpacaView.ViewShell( AlpacaModel, type )
            self.ModelBrick = alpacaView.ViewBrick( AlpacaModel)
            #NODE TAG VIEW
            if nodeTag is True:
                self.Nodes = [ [inode.nodeTag, inode.Pos] for inode in AlpacaModel.nodes]
            else:
                self.Nodes = []
            #ELE TAG VIEW
            if eleTag is True:
                TagBeam = [ [item.eleTag, item.getPerpFrame().Origin] for item in AlpacaModel.beams]
                TagShell = [ [item.eleTag, rg.AreaMassProperties.Compute( item.Mesh, False, True, False, False ).Centroid] for item in AlpacaModel.shells]
                TagBrick = [ [item.eleTag, rg.AreaMassProperties.Compute( item.Mesh, False, True, False, False ).Centroid] for item in AlpacaModel.bricks]
                self.TagEle = TagBeam + TagShell + TagBrick
            else:
                self.TagEle = []
            #LOCAL AXIS
            if localAxis is True:
                self.localAxis = [ item.getPerpFrame() for item in AlpacaModel.beams]
            else:
                self.localAxis = []
            #SUPPORT
            if support is True:
                scale = 0.5
                self.solidSupport = [ alpacaView.Support( iSupport, scale ) for iSupport in AlpacaModel.supports ]
            else:
                self.solidSupport = []
            # LOAD
            if load is True:
                self.viewLoad =[[item.Pos, item.Force, item.Moment] for item in AlpacaModel.loads]
            else:
                self.viewLoad = []
            self.forceBounds = ghcomp.Bounds([ item[1] for item in self.viewLoad])
            self.momentBounds = ghcomp.Bounds([ item[2] for item in self.viewLoad])

    def DrawViewportWires(self,arg):
        # Beam
        for iBeam in self.ModelBeam:
            color = iBeam[1]
            colorMaterial = rc.Display.DisplayMaterial(color, 0.3)
            if self.type is True:
                colorWirframe = System.Drawing.Color.Gray
                #System.Drawing.Color.LightGray
                arg.Display.DrawBrepShaded(iBeam[0], colorMaterial)
                arg.Display.DrawBrepWires(iBeam[0], colorWirframe)
            else :
                thickness =2
                arg.Display.DrawCurve(iBeam[0], color, thickness)
        # Mesh
        for iShell in self.ModelShell:
            color = iShell[1]
            #color = System.Drawing.Color.Blue
            colorMaterial = rc.Display.DisplayMaterial(color,color,color,color,1,0)
            colorMaterial.IsTwoSided = False
            arg.Display.DrawMeshShaded(iShell[0], colorMaterial)
            colorWirframe = System.Drawing.Color.Black
            arg.Display.DrawMeshWires(iShell[0], colorWirframe)
        #Brick 
        for iBrick in self.ModelBrick:
            color = iBrick[1]
            #color = System.Drawing.Color.Blue
            colorMaterial = rc.Display.DisplayMaterial(color,color,color,color,1,0)
            colorMaterial.IsTwoSided = False
            arg.Display.DrawMeshShaded(iBrick[0], colorMaterial)
            colorWirframe = System.Drawing.Color.Black
            arg.Display.DrawMeshWires(iBrick[0], colorWirframe)
            
        # node Tag view
        for inode in self.Nodes:
            arg.Display.Draw2dText( str(inode[0]), System.Drawing.Color.DarkSlateBlue, inode[1], True, 50)
        # ele Tag view
        for iEle in self.TagEle:
            arg.Display.Draw2dText( str(iEle[0]), System.Drawing.Color.BlanchedAlmond, iEle[1], True, 50)
        # local Axis
        for iLocalAxis in self.localAxis:
            arg.Display.DrawArrow( rg.Line(iLocalAxis.Origin, iLocalAxis.XAxis), System.Drawing.Color.Red)
            arg.Display.DrawArrow( rg.Line(iLocalAxis.Origin, iLocalAxis.YAxis), System.Drawing.Color.Green)
            arg.Display.DrawArrow( rg.Line(iLocalAxis.Origin, iLocalAxis.ZAxis), System.Drawing.Color.Blue)
            
        color = System.Drawing.Color.Azure
        colorWirframe = System.Drawing.Color.Black
        colorMaterial = rc.Display.DisplayMaterial(color, 0.0)
        for iSupport in self.solidSupport :
            arg.Display.DrawBrepShaded( iSupport, colorMaterial)
            arg.Display.DrawBrepWires( iSupport, colorWirframe)
            
        for iLoad in self.viewLoad:
            arg.Display.DrawArrow( rg.Line(iLoad[0], iLoad[1]/self.forceBounds[1]) ,  System.Drawing.Color.DarkRed)
            arg.Display.DrawArrow( rg.Line(iLoad[0], iLoad[2]/self.momentBounds[1]) ,  System.Drawing.Color.DarkBlue)
# ---------- end vm ----------
ra = RunAnalysisAlpaca4d(AlpacaModel=am.AlpacaModel, Settings=as.Settings)  # -> log, AlpacaSolvedModel
# ---------- ra: Python ----------
"""
Run an OpenSees Analysis
-
    Args:
        AlpacaModel:
        Settings:
    Returns:
        AlpacaSolvedModel:
"""



import Rhino.RhinoDoc
import Grasshopper as gh
import copy
import rhinoscriptsyntax as rs
import os
import time
import sys



ghenv.Component.Name = "Run Analysis (Alpaca4d)"
ghenv.Component.NickName = 'RA'
ghenv.Component.Message = "Run Analysis (Alpaca4d)"

ghcompfolder = gh.Folders.DefaultAssemblyFolder
if ghcompfolder not in sys.path:
    sys.path.append(ghcompfolder)

try:
    from Alpaca4d import alpaca4d as alpaca
except:
    msg = "Cannot import Alpaca4d. Is the Alpaca4d folder available in " + ghcompfolder + "?"
    ghenv.Component.AddRuntimeMessage(gh.Kernel.GH_RuntimeMessageLevel.Error, msg)


checkData = True



if not AlpacaModel:
    checkData = False
    msg = "Input parameter AlpacaModel failed to collect data"
    ghenv.Component.AddRuntimeMessage(gh.Kernel.GH_RuntimeMessageLevel.Warning, msg)


if not Settings:
    checkData = False
    msg = "Input parameter Settings failed to collect data"
    ghenv.Component.AddRuntimeMessage(gh.Kernel.GH_RuntimeMessageLevel.Warning, msg)


if checkData:
    FolderPath = rs.DocumentPath()
    os.chdir(FolderPath)
    
    outputFileName = 'openSeesModel'
    recorderFileName = 'recorder.mpco'
    
    for dirpath, dirnames, filenames in os.walk(FolderPath):
        for filename in filenames:
            if filename == outputFileName:
                file = os.path.join(dirpath,outputFileName)
                os.remove(file)
            elif filename == recorderFileName:
                file = os.path.join(dirpath,recorderFileName)
                os.remove(file)
    
    
    # create a copy
    
    AnalysisModel = copy.copy(AlpacaModel)
    AnalysisModel.py = list(AnalysisModel.py)
    
    # generate Recorder and assign name
    AnalysisModel.recorderName = "recorder" + ".mpco"
    
    AnalysisModel.py.append(alpaca.TCLRecorder.mpco(AnalysisModel.recorderName, True,True,True,True,False,False,True,True,True,True))
    
    
    AnalysisModel.analysis = Settings
    AnalysisModel.py.append(Settings.write_tcl())
    AnalysisModel.py.append("wipe")
    
    
    #textFile = AnalysisModel.py
    
    time_start = time.clock()
    
    AnalysisModel.writeFile(outputFileName)
    
    time_elapsed = (time.clock() - time_start)
    print("Writing Time {}".format(time_elapsed))
    
    
    
    time_start = time.clock()
    
    executable = os.path.join(ghcompfolder,'Alpaca4d\OpenSees-Solvers\opensees.bat')
    a, log = AnalysisModel.runOpensees(executable)
    
    
    time_elapsed = (time.clock() - time_start)
    print("Analyses Time {}".format(time_elapsed))
    
    AlpacaSolvedModel = copy.copy(AnalysisModel)
    AlpacaSolvedModel.isAnalysed = True
# ---------- end ra ----------
ds = DisassembleModelAlpaca4d(AlpacaModel=ra.AlpacaSolvedModel)  # -> out, Points, threeNdfPoints, sixNdfPoints, Beam, Shell, Brick, Support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
# ---------- ds: Python ----------
"""
Disassemble a Model
-
    Args:
        AlpacaModel:
    Returns:
        Points:
        threeNdfPoints:
        sixNdfPoints:
        
        Beam:
        Shell:
        Brick:
        Support:
        Constraint:
        TimeSeries:
        Load:
        Material:
"""

ghenv.Component.Name = "Disassemble Model (Alpaca4d)"
ghenv.Component.NickName = 'DS'
ghenv.Component.Message = "Disassemble Model (Alpaca4d)"


import sys
import Rhino.Geometry as rg
import Grasshopper as gh


## add alpaca install directory to system path

ghcompfolder = gh.Folders.DefaultAssemblyFolder
if ghcompfolder not in sys.path:
    sys.path.append(ghcompfolder)

try:
    from Alpaca4d import alpaca4d as alpaca
except:
    msg = "Cannot import Alpaca4d. Is the Alpaca4d folder available in " + ghcompfolder + "?"
    ghenv.Component.AddRuntimeMessage(gh.Kernel.GH_RuntimeMessageLevel.Error, msg)

checkData = True


if not AlpacaModel:
    checkData = False
    msg = "Input parameter AlpacaModel failed to collect data"
    ghenv.Component.AddRuntimeMessage(gh.Kernel.GH_RuntimeMessageLevel.Warning, msg)

if checkData:
    Points = AlpacaModel.uniquePoints
    threeNdfPoints = AlpacaModel.uniquePointsThreeNDF
    sixNdfPoints = AlpacaModel.uniquePointsSixNDF
    
    Beam = AlpacaModel.beams
    Shell  = AlpacaModel.shells
    Brick = AlpacaModel.bricks
    Support = AlpacaModel.supports
    Constraint = AlpacaModel.constraints
    TimeSeries = AlpacaModel.timeSeries
    Load = AlpacaModel.loads
    Material = AlpacaModel.materials
# ---------- end ds ----------
nd = NodalDisplacementsAlpaca4d(AlpacaModel=ra.AlpacaSolvedModel)  # -> out, displacement, rotation; inputs History: Boolean, step: Int32; disabled
# ---------- nd: Python ----------
"""
Read displacement results
-
    Args:
        AlpacaModel:
        History: True to visualise the displacement and rotation history of the points
        step:
    Returns:
        displacement:
        rotation:
        displacement_History:
        rotation_History:
"""

ghenv.Component.Name = "Nodal Displacements (Alpaca4d)"
ghenv.Component.NickName = 'ND'
ghenv.Component.Message = "Displacements (Alpaca4d)"

import sys
import os
import System
from System.Drawing import Color


import clr
import clrtype
import Rhino.Geometry as rg
import rhinoscriptsyntax as rs
import Grasshopper as gh
import copy
import ghpythonlib.treehelpers as th



## add alpaca install directory to system path

ghcompfolder = gh.Folders.DefaultAssemblyFolder
if ghcompfolder not in sys.path:
    sys.path.append(ghcompfolder)

try:
    from Alpaca4d import alpaca4d as alpaca
except:
    msg = "Cannot import Alpaca4d. Is the Alpaca4d folder available in " + ghcompfolder + "?"
    ghenv.Component.AddRuntimeMessage(gh.Kernel.GH_RuntimeMessageLevel.Error, msg)



FolderPath = rs.DocumentPath()
os.chdir(FolderPath)

my_module_name = "Alpaca_StepReader" # replace this with something unique that doesn't collide with a real module!
my_module = sys.modules.setdefault(my_module_name, type(sys)(my_module_name))

hdfFilePath = os.path.join(ghcompfolder, "Alpaca4d\HDF5CSharp.dll")
clr.AddReferenceToFileAndPath(hdfFilePath)


from HDF5CSharp import Hdf5

try:
    Steps = my_module.Steps
except AttributeError:
    type_2d = type(System.Array.CreateInstance(float, 1, 1))

    class Steps(object):
        __metaclass__ = clrtype.ClrClass
        _clrfields = {"STEP_{}".format(i): type_2d for i in range(1000)} # it will work for model with less than 1000 steps

    my_module.Steps = Steps



checkData = True

if not AlpacaModel:
    checkData = False
    msg = "Input parameter AlpacaModel failed to collect data"
    ghenv.Component.AddRuntimeMessage(gh.Kernel.GH_RuntimeMessageLevel.Warning, msg)



History = False if History is None else History


if checkData:
    step = (int(AlpacaModel.analysis.NumberOfSteps) - 1) if step is None else step
    numberOfPoints = len(AlpacaModel.uniquePoints) #
    
    if not History:
        try:
            fileId = Hdf5.OpenFile(AlpacaModel.recorderName, True)
            
            
            displacementResult = Hdf5.ReadObject[Steps](fileId, "/MODEL_STAGE[1]/RESULTS/ON_NODES/DISPLACEMENT/DATA")
            displacement = []
            for i in range(numberOfPoints):
                x = getattr(displacementResult, 'STEP_{}'.format(step))[i,0]
                y = getattr(displacementResult, 'STEP_{}'.format(step))[i,1]
                z = getattr(displacementResult, 'STEP_{}'.format(step))[i,2]
                displacement.append(rg.Vector3d(x,y,z))
            
            
            rotationResult = Hdf5.ReadObject[Steps](fileId, "/MODEL_STAGE[1]/RESULTS/ON_NODES/ROTATION/DATA")
            rotation = []
            for i in range(numberOfPoints):
                x = getattr(rotationResult, 'STEP_{}'.format(step))[i,0]
                y = getattr(rotationResult, 'STEP_{}'.format(step))[i,1]
                z = getattr(rotationResult, 'STEP_{}'.format(step))[i,2]
                rotation.append(rg.Vector3d(x,y,z))
                
                
            Hdf5.CloseFile(fileId)
            print("I have closed the file")
        except:
            if fileId >0:
                Hdf5.CloseFile(fileId)
                print("I have closed the file because of exception")
    
    
    
    if History:
        try:
            fileId = Hdf5.OpenFile(AlpacaModel.recorderName, True)
            
            displacementResult = Hdf5.ReadObject[Steps](fileId, "/MODEL_STAGE[1]/RESULTS/ON_NODES/DISPLACEMENT/DATA")
            displacement = []
            
            for i in range(numberOfPoints):
                dispTemp = []
                maxNumberStep = int(AlpacaModel.analysis.NumberOfSteps)
                for n_step in range(maxNumberStep):
                    x = getattr(displacementResult, 'STEP_{}'.format(n_step))[i,0]
                    y = getattr(displacementResult, 'STEP_{}'.format(n_step))[i,1]
                    z = getattr(displacementResult, 'STEP_{}'.format(n_step))[i,2]
                    dispTemp.append(rg.Vector3d(x,y,z))
                    
                
                displacement.append(dispTemp)
    
    
    
    
            rotationResult = Hdf5.ReadObject[Steps](fileId, "/MODEL_STAGE[1]/RESULTS/ON_NODES/ROTATION/DATA")
            
            rotation = []
            
            for i in range(numberOfPoints):
                rotationTemp = []
                for n_step in range(maxNumberStep):
                    x = getattr(rotationResult, 'STEP_{}'.format(n_step))[i,0]
                    y = getattr(rotationResult, 'STEP_{}'.format(n_step))[i,1]
                    z = getattr(rotationResult, 'STEP_{}'.format(n_step))[i,2]
                    rotationTemp.append(rg.Vector3d(x,y,z))
                
                rotation.append(rotationTemp)
                
            Hdf5.CloseFile(fileId)
        except:
            Hdf5.CloseFile(fileId)
    
    
    displacement = th.list_to_tree(displacement)
    rotation = th.list_to_tree(rotation)
# ---------- end nd ----------
pt_7 = Point(ds.sixNdfPoints)  # disabled
vlen = VectorLength(Vector=nd.displacement)  # disabled
number_slider_6 = Slider(0.19, range=0..0.4)  # disabled
number_slider_7 = Slider(0.121, range=0..2)  # disabled
bnd_3 = Bounds(Numbers=vlen)
remap = RemapNumbers(Value=vlen, Source=bnd_3, Target=Domain(0, 1))  # -> Mapped, Clipped
dom_3 = ConstructDomain(DomainStart=number_slider_7, DomainEnd=number_slider_6)
number_slider_8 = Slider(2, range=0..3)
toggle_2 = BooleanToggle(True)
col = Colour(reverse([ColourSwatch(SwatchColor=RGB(204, 0, 71)), ColourSwatch(SwatchColor=RGB(0, 0, 207)), ColourSwatch(SwatchColor=RGB(255, 182, 71)), ColourSwatch(SwatchColor=RGB(26, 180, 214)), ColourSwatch(SwatchColor=RGB(206, 255, 115))]))
remap_2 = RemapNumbers(Value=vlen, Source=bnd_3, Target=dom_3)  # -> Mapped, Clipped
gradientlibrary = GradientLibrary(gradIndex=Slider(11, range=0..12))  # -> colors; inputs gradIndex: Int32
#   port colors: A series of colors to be plugged into the "Ladybug_Legend Parameters" component.
# ---------- gradientlibrary: Python ----------
"""
Preset of gradient colors perfect for Data Visualisation
    Inputs:
        gradIndex: An index refering to one of the following possible gradients:
            0 - Orignal Ladybug
            1 - Nuanced Ladybug
            2 - Multi-colored Ladybug
            3 - Ecotect
            4 - Thermal Comfort Percentage
            5 - Thermal Comfort Colors
            6 - Shade Benefit/Harm
            7 - Shade Harm
            8 - Shade Benefit
            9 - CFD Colors 1
            10 - Radiation Benefit
            11 - Gsa10 Colour
            12 - Gsa9 Colour
    Returns:
        customColors: A series of colors.
"""

ghenv.Component.Name = "Gradient Library"
ghenv.Component.NickName = 'GradientLibrary'
#ghenv.Component.Message = 'GradientLibrary\nWIP'

import scriptcontext as sc
import Grasshopper.Kernel as gh
import System

gradientLibrary = {
        0: [System.Drawing.Color.FromArgb(75, 107, 169), System.Drawing.Color.FromArgb(115, 147, 202), System.Drawing.Color.FromArgb(170, 200, 247), System.Drawing.Color.FromArgb(193, 213, 208), System.Drawing.Color.FromArgb(245, 239, 103), System.Drawing.Color.FromArgb(252, 230, 74), System.Drawing.Color.FromArgb(239, 156, 21), System.Drawing.Color.FromArgb(234, 123, 0), System.Drawing.Color.FromArgb(234, 74, 0), System.Drawing.Color.FromArgb(234, 38, 0)],
        1: [System.Drawing.Color.FromArgb(49,54,149), System.Drawing.Color.FromArgb(69,117,180), System.Drawing.Color.FromArgb(116,173,209), System.Drawing.Color.FromArgb(171,217,233), System.Drawing.Color.FromArgb(224,243,248), System.Drawing.Color.FromArgb(255,255,191), System.Drawing.Color.FromArgb(254,224,144), System.Drawing.Color.FromArgb(253,174,97), System.Drawing.Color.FromArgb(244,109,67), System.Drawing.Color.FromArgb(215,48,39), System.Drawing.Color.FromArgb(165,0,38)],
        2: [System.Drawing.Color.FromArgb(4,25,145), System.Drawing.Color.FromArgb(7,48,224), System.Drawing.Color.FromArgb(7,88,255), System.Drawing.Color.FromArgb(1,232,255), System.Drawing.Color.FromArgb(97,246,156), System.Drawing.Color.FromArgb(166,249,86), System.Drawing.Color.FromArgb(254,244,1), System.Drawing.Color.FromArgb(255,121,0), System.Drawing.Color.FromArgb(239,39,0), System.Drawing.Color.FromArgb(138,17,0)],
        3: [System.Drawing.Color.FromArgb(0,0,255), System.Drawing.Color.FromArgb(53,0,202), System.Drawing.Color.FromArgb(107,0,148), System.Drawing.Color.FromArgb(160,0,95), System.Drawing.Color.FromArgb(214,0,41), System.Drawing.Color.FromArgb(255,12,0), System.Drawing.Color.FromArgb(255,66,0), System.Drawing.Color.FromArgb(255,119,0), System.Drawing.Color.FromArgb(255,173,0), System.Drawing.Color.FromArgb(255,226,0), System.Drawing.Color.FromArgb(255,255,0)],
        4: [System.Drawing.Color.FromArgb(0,0,0), System.Drawing.Color.FromArgb(110,0,153), System.Drawing.Color.FromArgb(255,0,0), System.Drawing.Color.FromArgb(255,255,102), System.Drawing.Color.FromArgb(255,255,255)],
        5: [System.Drawing.Color.FromArgb(0,136,255), System.Drawing.Color.FromArgb(200,225,255), System.Drawing.Color.FromArgb(255,255,255), System.Drawing.Color.FromArgb(255,230,230), System.Drawing.Color.FromArgb(255,0,0)],
        6: [System.Drawing.Color.FromArgb(5,48,97), System.Drawing.Color.FromArgb(33,102,172), System.Drawing.Color.FromArgb(67,147,195), System.Drawing.Color.FromArgb(146,197,222), System.Drawing.Color.FromArgb(209,229,240), System.Drawing.Color.FromArgb(255,255,255), System.Drawing.Color.FromArgb(253,219,199), System.Drawing.Color.FromArgb(244,165,130), System.Drawing.Color.FromArgb(214,96,77), System.Drawing.Color.FromArgb(178,24,43), System.Drawing.Color.FromArgb(103,0,31)],
        7: [System.Drawing.Color.FromArgb(255,255,255), System.Drawing.Color.FromArgb(253,219,199), System.Drawing.Color.FromArgb(244,165,130), System.Drawing.Color.FromArgb(214,96,77), System.Drawing.Color.FromArgb(178,24,43), System.Drawing.Color.FromArgb(103,0,31)],
        8: [System.Drawing.Color.FromArgb(255,255,255), System.Drawing.Color.FromArgb(209,229,240), System.Drawing.Color.FromArgb(146,197,222), System.Drawing.Color.FromArgb(67,147,195), System.Drawing.Color.FromArgb(33,102,172), System.Drawing.Color.FromArgb(5,48,97)],
        9: [System.Drawing.Color.FromArgb(0,16,120), System.Drawing.Color.FromArgb(38,70,160), System.Drawing.Color.FromArgb(5,180,222), System.Drawing.Color.FromArgb(16,180,109), System.Drawing.Color.FromArgb(59,183,35), System.Drawing.Color.FromArgb(143,209,19), System.Drawing.Color.FromArgb(228,215,29), System.Drawing.Color.FromArgb(246,147,17), System.Drawing.Color.FromArgb(243,74,0), System.Drawing.Color.FromArgb(255,0,0)],
        10: [System.Drawing.Color.FromArgb(0,191,48), System.Drawing.Color.FromArgb(255,238,184), System.Drawing.Color.FromArgb(255,0,0)],
        11: [System.Drawing.Color.FromArgb(204,0,71), System.Drawing.Color.FromArgb(255,182,71), System.Drawing.Color.FromArgb(206,255,115), System.Drawing.Color.FromArgb(26,180, 214),System.Drawing.Color.FromArgb(0,0,207)],
        12: [System.Drawing.Color.FromArgb(255, 51, 51), System.Drawing.Color.FromArgb(255, 170, 51), System.Drawing.Color.FromArgb(255, 255, 51), System.Drawing.Color.FromArgb(170, 255, 125), System.Drawing.Color.FromArgb(51, 255, 231), System.Drawing.Color.FromArgb(51, 170, 255), System.Drawing.Color.FromArgb(51,51, 255)]}
colors = gradientLibrary[gradIndex]
# ---------- end gradientlibrary ----------
panel_2 = Panel("0.1")
twnthrucols = TweenThroughColors(
    Colors=col,
    Factor=remap.Mapped,
    Normalized=True,
    Equalized=False,
    Weighted=False,
    Degree=3,
    InterpolationType=0,
    Alpha=True)
dots = DotDisplay(Point=ds.Points, Colour=twnthrucols, Size=remap_2.Mapped)
nd_2 = NodalDisplacementsAlpaca4d(AlpacaModel=ra.AlpacaSolvedModel)  # -> out, displacement, rotation; inputs History: Boolean, step: Int32; same code as nd
vlen_2 = VectorLength(Vector=nd_2.displacement)
bnd_4 = Bounds(Numbers=vlen_2)
ss = ShellStressesAlpaca4d(AlpacaModel=ra.AlpacaSolvedModel)  # -> out, p11, p22, p12, m11, m22, m12, q1, q2; inputs History: Boolean, step: Int32
# ---------- ss: Python ----------
"""
Read Shell Stresses
-
    Args:
        AlpacaModel:
        step:
    Returns:
        p11:
        p22:
        p12:
        m11:
        m22:
        m12:
        q1:
        q2:
"""

ghenv.Component.Name = "Shell Stresses (Alpaca4d)"
ghenv.Component.NickName = 'SS'
ghenv.Component.Message = "Shell Stresses (Alpaca4d)"

import sys
import os
import System
from System.Drawing import Color


import clr
import clrtype
import Rhino.Geometry as rg
import rhinoscriptsyntax as rs
import Grasshopper as gh
import copy
import ghpythonlib.treehelpers as th


## add alpaca install directory to system path

ghcompfolder = gh.Folders.DefaultAssemblyFolder
if ghcompfolder not in sys.path:
    sys.path.append(ghcompfolder)

try:
    from Alpaca4d import alpaca4d as alpaca
except:
    msg = "Cannot import Alpaca4d. Is the Alpaca4d folder available in " + ghcompfolder + "?"
    ghenv.Component.AddRuntimeMessage(gh.Kernel.GH_RuntimeMessageLevel.Error, msg)



FolderPath = rs.DocumentPath()
os.chdir(FolderPath)


# import costum modules to read the hdf5 file

my_module_name = "Alpaca_StepReader"
my_module = sys.modules.setdefault(my_module_name, type(sys)(my_module_name))

hdfFilePath = os.path.join(ghcompfolder, "Alpaca4d\HDF5CSharp.dll")
clr.AddReferenceToFileAndPath(hdfFilePath)

from HDF5CSharp import Hdf5

try:
    Steps = my_module.Steps
except AttributeError:
    type_2d = type(System.Array.CreateInstance(float, 1, 1))

    class Steps(object):
        __metaclass__ = clrtype.ClrClass
        _clrfields = {"STEP_{}".format(i): type_2d for i in range(1000)} # it will work for model with less than 1000 steps

    my_module.Steps = Steps


checkData = True

if not AlpacaModel:
    checkData = False
    msg = "Input parameter AlpacaModel failed to collect data"
    ghenv.Component.AddRuntimeMessage(gh.Kernel.GH_RuntimeMessageLevel.Warning, msg)

History = False if History is None else History



if checkData:
    
    step = (int(AlpacaModel.analysis.NumberOfSteps) - 1) if step is None else step
# read result
    
    p11 = []
    p22 = []
    p12 = []
    
    m11 = []
    m22 = []
    m12 = []
    
    q1 = []
    q2 = []
    
    
    
    ## to fix the issue about index of different type of object
    
    if History == False:
        try:
            fileId = Hdf5.OpenFile(AlpacaModel.recorderName, True)
            
            
            
            shellSortedByeleTag = sorted(AlpacaModel.shells, key=lambda x: x.eleTag)
            
            ShellDKGT = []
            ShellMITC4 = []
            ASDShellQ4 = []
            
            
            for item in shellSortedByeleTag:
                if item.elementType == "ShellDKGT":
                    ShellDKGT.append(item)
                elif item.elementType == "ShellMITC4":
                    ShellMITC4.append(item)
                elif item.elementType == "ASDShellQ4":
                    ASDShellQ4.append(item)
            
            shellElements = [ShellDKGT, ShellMITC4, ASDShellQ4]
            
            #shellMITC4
            stressResultMITC4 = Hdf5.ReadObject[Steps](fileId, "/MODEL_STAGE[1]/RESULTS/ON_ELEMENTS/stresses/53-UnknownMovableObject[201:0:0]/DATA")
            #ShellNLDKGT
            stressResultNLDKGT = Hdf5.ReadObject[Steps](fileId, "/MODEL_STAGE[1]/RESULTS/ON_ELEMENTS/stresses/167-UnknownMovableObject[103:0:0]/DATA")
            #asdea shell
            stressResultASDShellQ4 = Hdf5.ReadObject[Steps](fileId, "/MODEL_STAGE[1]/RESULTS/ON_ELEMENTS/stresses/203-UnknownMovableObject[201:0:0]/DATA")
            
            for j,stressResult in enumerate([stressResultNLDKGT, stressResultMITC4, stressResultASDShellQ4]):
                for i in range(len(shellElements[j])):
                    p11_0 = getattr(stressResult, 'STEP_{}'.format(step))[i,0]
                    p11_1 = getattr(stressResult, 'STEP_{}'.format(step))[i,8]
                    p11_2 = getattr(stressResult, 'STEP_{}'.format(step))[i,16]
                    p11_3 = getattr(stressResult, 'STEP_{}'.format(step))[i,24]
                    
                    p11.append([p11_0,p11_1,p11_2,p11_3])
                    
                    
                    
                    p22_0 = getattr(stressResult, 'STEP_{}'.format(step))[i,1]
                    p22_1 = getattr(stressResult, 'STEP_{}'.format(step))[i,9]
                    p22_2 = getattr(stressResult, 'STEP_{}'.format(step))[i,17]
                    p22_3 = getattr(stressResult, 'STEP_{}'.format(step))[i,25]
                    
                    p22.append([p22_0,p22_1,p22_2,p22_3])
                    
                    
                    p12_0 = getattr(stressResult, 'STEP_{}'.format(step))[i,2]
                    p12_1 = getattr(stressResult, 'STEP_{}'.format(step))[i,10]
                    p12_2 = getattr(stressResult, 'STEP_{}'.format(step))[i,18]
                    p12_3 = getattr(stressResult, 'STEP_{}'.format(step))[i,26]
                    
                    p12.append([p12_0,p12_1,p12_2,p12_3])
                    
                    
                    m11_0 = getattr(stressResult, 'STEP_{}'.format(step))[i,3]
                    m11_1 = getattr(stressResult, 'STEP_{}'.format(step))[i,11]
                    m11_2 = getattr(stressResult, 'STEP_{}'.format(step))[i,19]
                    m11_3 = getattr(stressResult, 'STEP_{}'.format(step))[i,27]
                    
                    m11.append([m11_0,m11_1,m11_2,m11_3])
                    
                    
                    m22_0 = getattr(stressResult, 'STEP_{}'.format(step))[i,4]
                    m22_1 = getattr(stressResult, 'STEP_{}'.format(step))[i,12]
                    m22_2 = getattr(stressResult, 'STEP_{}'.format(step))[i,20]
                    m22_3 = getattr(stressResult, 'STEP_{}'.format(step))[i,28]
                    
                    m22.append([m22_0,m22_1,m22_2,m22_3])
                    
                    
                    m12_0 = getattr(stressResult, 'STEP_{}'.format(step))[i,5]
                    m12_1 = getattr(stressResult, 'STEP_{}'.format(step))[i,13]
                    m12_2 = getattr(stressResult, 'STEP_{}'.format(step))[i,21]
                    m12_3 = getattr(stressResult, 'STEP_{}'.format(step))[i,29]
                    
                    m12.append([m12_0,m12_1,m12_2,m12_3])
                    
                    
                    q1_0 = getattr(stressResult, 'STEP_{}'.format(step))[i,6]
                    q1_1 = getattr(stressResult, 'STEP_{}'.format(step))[i,14]
                    q1_2 = getattr(stressResult, 'STEP_{}'.format(step))[i,22]
                    q1_3 = getattr(stressResult, 'STEP_{}'.format(step))[i,30]
                    
                    q1.append([q1_0,q1_1,q1_2,q1_3])
                    
                    
                    q2_0 = getattr(stressResult, 'STEP_{}'.format(step))[i,7]
                    q2_1 = getattr(stressResult, 'STEP_{}'.format(step))[i,15]
                    q2_2 = getattr(stressResult, 'STEP_{}'.format(step))[i,23]
                    q2_3 = getattr(stressResult, 'STEP_{}'.format(step))[i,31]
                    
                    q2.append([q2_0,q2_1,q2_2,q2_3])
                    
                    
                    
            Hdf5.CloseFile(fileId)
            print("I have close the file")
            
        except:
            Hdf5.CloseFile(fileId)
            print("I have close the file")
    
    
    elif History == True:
        try:
            fileId = Hdf5.OpenFile(AlpacaModel.recorderName, True)
        
            maxNumberStep = int(AlpacaModel.analysis.NumberOfSteps)
            shellSortedByeleTag = sorted(AlpacaModel.shells, key=lambda x: x.eleTag)
            
            ShellDKGT = []
            ShellMITC4 = []
            ASDShellQ4 = []
            
            
            for item in shellSortedByeleTag:
                if item.elementType == "ShellDKGT":
                    ShellDKGT.append(item)
                elif item.elementType == "ShellMITC4":
                    ShellMITC4.append(item)
                elif item.elementType == "ASDShellQ4":
                    ASDShellQ4.append(item)
            
            shellElements = [ShellDKGT, ShellMITC4, ASDShellQ4]
            
            #shellMITC4
            stressResultMITC4 = Hdf5.ReadObject[Steps](fileId, "/MODEL_STAGE[1]/RESULTS/ON_ELEMENTS/stresses/53-UnknownMovableObject[201:0:0]/DATA")
            #ShellNLDKGT
            stressResultNLDKGT = Hdf5.ReadObject[Steps](fileId, "/MODEL_STAGE[1]/RESULTS/ON_ELEMENTS/stresses/167-UnknownMovableObject[103:0:0]/DATA")
            #asdea shell
            stressResultASDShellQ4 = Hdf5.ReadObject[Steps](fileId, "/MODEL_STAGE[1]/RESULTS/ON_ELEMENTS/stresses/203-UnknownMovableObject[201:0:0]/DATA")
            
            
            
            for j,stressResult in enumerate([stressResultNLDKGT, stressResultMITC4, stressResultASDShellQ4]):
                for i in range(len(shellElements[j])):
                    p11Temp = []
                    p22Temp = []
                    p12Temp = []
                    
                    m11Temp = []
                    m22Temp = []
                    m12Temp = []
                    
                    q1Temp = []
                    q2Temp = []
                    
                    
                    for n_step in range(maxNumberStep):
                        p11_0 = getattr(stressResult, 'STEP_{}'.format(n_step))[i,0]
                        p11_1 = getattr(stressResult, 'STEP_{}'.format(n_step))[i,8]
                        p11_2 = getattr(stressResult, 'STEP_{}'.format(n_step))[i,16]
                        p11_3 = getattr(stressResult, 'STEP_{}'.format(n_step))[i,24]
                        
                        p11Temp.append([p11_0,p11_1,p11_2,p11_3])
                        
                        
                        
                        p22_0 = getattr(stressResult, 'STEP_{}'.format(n_step))[i,1]
                        p22_1 = getattr(stressResult, 'STEP_{}'.format(n_step))[i,9]
                        p22_2 = getattr(stressResult, 'STEP_{}'.format(n_step))[i,17]
                        p22_3 = getattr(stressResult, 'STEP_{}'.format(n_step))[i,25]
                        
                        p22Temp.append([p22_0,p22_1,p22_2,p22_3])
                        
                        
                        p12_0 = getattr(stressResult, 'STEP_{}'.format(n_step))[i,2]
                        p12_1 = getattr(stressResult, 'STEP_{}'.format(n_step))[i,10]
                        p12_2 = getattr(stressResult, 'STEP_{}'.format(n_step))[i,18]
                        p12_3 = getattr(stressResult, 'STEP_{}'.format(n_step))[i,26]
                        
                        p12Temp.append([p12_0,p12_1,p12_2,p12_3])
                        
                        
                        m11_0 = getattr(stressResult, 'STEP_{}'.format(n_step))[i,3]
                        m11_1 = getattr(stressResult, 'STEP_{}'.format(n_step))[i,11]
                        m11_2 = getattr(stressResult, 'STEP_{}'.format(n_step))[i,19]
                        m11_3 = getattr(stressResult, 'STEP_{}'.format(n_step))[i,27]
                        
                        m11Temp.append([m11_0,m11_1,m11_2,m11_3])
                        
                        
                        m22_0 = getattr(stressResult, 'STEP_{}'.format(n_step))[i,4]
                        m22_1 = getattr(stressResult, 'STEP_{}'.format(n_step))[i,12]
                        m22_2 = getattr(stressResult, 'STEP_{}'.format(n_step))[i,20]
                        m22_3 = getattr(stressResult, 'STEP_{}'.format(n_step))[i,28]
                        
                        m22Temp.append([m22_0,m22_1,m22_2,m22_3])
                        
                        
                        m12_0 = getattr(stressResult, 'STEP_{}'.format(n_step))[i,5]
                        m12_1 = getattr(stressResult, 'STEP_{}'.format(n_step))[i,13]
                        m12_2 = getattr(stressResult, 'STEP_{}'.format(n_step))[i,21]
                        m12_3 = getattr(stressResult, 'STEP_{}'.format(n_step))[i,29]
                        
                        m12Temp.append([m12_0,m12_1,m12_2,m12_3])
                        
                        
                        q1_0 = getattr(stressResult, 'STEP_{}'.format(n_step))[i,6]
                        q1_1 = getattr(stressResult, 'STEP_{}'.format(n_step))[i,14]
                        q1_2 = getattr(stressResult, 'STEP_{}'.format(n_step))[i,22]
                        q1_3 = getattr(stressResult, 'STEP_{}'.format(n_step))[i,30]
                        
                        q1Temp.append([q1_0,q1_1,q1_2,q1_3])
                        
                        
                        q2_0 = getattr(stressResult, 'STEP_{}'.format(n_step))[i,7]
                        q2_1 = getattr(stressResult, 'STEP_{}'.format(n_step))[i,15]
                        q2_2 = getattr(stressResult, 'STEP_{}'.format(n_step))[i,23]
                        q2_3 = getattr(stressResult, 'STEP_{}'.format(n_step))[i,31]
                        
                        q2Temp.append([q2_0,q2_1,q2_2,q2_3])
                    
                    p11.append(p11Temp)
                    p22.append(p22Temp)
                    p12.append(p12Temp)
                    
                    m11.append(m11Temp)
                    m22.append(m22Temp)
                    m12.append(m12Temp)
                    
                    q1.append(q1Temp)
                    q2.append(q2Temp)
            Hdf5.CloseFile(fileId)
            print("I have close the file")
        except:
            Hdf5.CloseFile(fileId)
            print("I have close the file")
    
    
    shellElementsFlat = []
    for sublist in shellElements:
        for item in sublist:
            shellElementsFlat.append(item.eleTag)
    
    
    
    
    
    p11 = [x for _,x in sorted(zip(shellElementsFlat, p11))]
    p22 = [x for _,x in sorted(zip(shellElementsFlat, p22))]
    p12 = [x for _,x in sorted(zip(shellElementsFlat, p12))]
    
    
    m11 = [x for _,x in sorted(zip(shellElementsFlat, m11))]
    m22 = [x for _,x in sorted(zip(shellElementsFlat, m22))]
    m12 = [x for _,x in sorted(zip(shellElementsFlat, m12))]
    
    
    q1 = [x for _,x in sorted(zip(shellElementsFlat, q1))]
    q2 = [x for _,x in sorted(zip(shellElementsFlat, q2))]
    
    
    
    p11 = th.list_to_tree(p11)
    p22 = th.list_to_tree(p22)
    p12 = th.list_to_tree(p12)
    
    m11 = th.list_to_tree(m11)
    m22 = th.list_to_tree(m22)
    m12 = th.list_to_tree(m12)
    
    q1 = th.list_to_tree(q1)
    q2 = th.list_to_tree(q2)
# ---------- end ss ----------
panel_3 = Panel(bnd_4)

number_slider_9 = Slider(12, range=0..100)
gradientlibrary_2 = GradientLibrary(gradIndex=Slider(3, range=0..12))  # -> colors; inputs gradIndex: Int32; same code as gradientlibrary
swatch = ColourSwatch(SwatchColor=RGB(0, 0, 0))

dm = DeformedModelAlpaca4d(AlpacaSolvedModel=ra.AlpacaSolvedModel, extrudeModel=Toggle(True), listColor=gradientlibrary_2)  # -> DefModel, bounds; inputs step: Int32, extrudeModel: Boolean, typeColor: Int32, listColor: list of Color
# ---------- dm: Python ----------
"""View Deformed model
    Args:
        AlpacaSolvedModel: Output of Analyses solver
        step:
        scale: Multiplication factor for displacement
        extrudeModel:  
True : view extruded model
else : view stick model
        typeColor:  View relative color of the traslation
<=0 : view traslation X 
1 : view traslation Y
2 : view traslation Z
>= 3 : view resulting displacement.
        listColor : one list of color 

    Output:
       DefModel: view deformed model
       bounds: max end min of displacement of the structure 
"""

ghenv.Component.Name = "Deformed Model (Alpaca4d)"
ghenv.Component.NickName = 'DM'
ghenv.Component.Message = "Deformed Model (Alpaca4d)"

from ghpythonlib.componentbase import executingcomponent as component
import System
import rhinoscriptsyntax as rs

import sys
import os
import clr
import clrtype
import Rhino.Geometry as rg
import Rhino as rc
import math as mt
import Grasshopper as gh
import ghpythonlib.treehelpers as th
from ghpythonlib.components import ConstructDomain

ghcompfolder = gh.Folders.DefaultAssemblyFolder
if ghcompfolder not in sys.path:
    sys.path.append(ghcompfolder)
try:
    from Alpaca4d import alpaca4dView as alpacaView
except:
    msg = "Cannot import Alpaca4d. Is the Alpaca4d folder available in " + ghcompfolder + "?"
    ghenv.Component.AddRuntimeMessage(gh.Kernel.GH_RuntimeMessageLevel.Error, msg)
    
FolderPath = rs.DocumentPath()
os.chdir(FolderPath)

ghcompfolder = gh.Folders.DefaultAssemblyFolder
my_module_name = "Alpaca_StepReader" # replace this with something unique that doesn't collide with a real module!
my_module = sys.modules.setdefault(my_module_name, type(sys)(my_module_name))

hdfFilePath = os.path.join(ghcompfolder, "Alpaca4d\HDF5CSharp.dll")
clr.AddReferenceToFileAndPath(hdfFilePath)


from HDF5CSharp import Hdf5

class MyComponent(component):
    
    def RunScript(self, AlpacaSolvedModel, step = None, scale = None , extrudeModel = None, typeColor = None, listColor = [] ):
        import sys
        
        self.extrudeModel = extrudeModel
        
        self.defModel1 = []
        self.defModel2 = []
        self.defModel3 = []
        
        self.beamColor = []
        

        if step == None:
            step = 0
        if scale == None:
            scale = 1
        if extrudeModel == None:
            extrudeModel = False
        if typeColor == None:
            typeColor = 3
        
        if not listColor: listColor = [ System.Drawing.Color.DarkViolet, 
                                        System.Drawing.Color.BlueViolet, 
                                        System.Drawing.Color.RoyalBlue, 
                                        System.Drawing.Color.CornflowerBlue,
                                        System.Drawing.Color.LightSkyBlue, 
                                        System.Drawing.Color.LightBlue,
                                        System.Drawing.Color.CadetBlue,
                                        System.Drawing.Color.LightGreen,
                                        System.Drawing.Color.GreenYellow,
                                        System.Drawing.Color.Yellow,
                                        System.Drawing.Color.Orange,
                                        System.Drawing.Color.Red,
                                        System.Drawing.Color.DarkRed]
        
        
        ghcompfolder = gh.Folders.DefaultAssemblyFolder
        if ghcompfolder not in sys.path:
            sys.path.append(ghcompfolder)
    
        try:
            Steps = my_module.Steps
        except AttributeError:
            type_2d = type(System.Array.CreateInstance(float, 1, 1))
                
            class Steps(object):
                __metaclass__ = clrtype.ClrClass
                _clrfields = {"STEP_{}".format(i): type_2d for i in range(1000)} # it will work for model with less than 1000 steps
                
            my_module.Steps = Steps
            
        checkData = True
        
        if not AlpacaSolvedModel:
            checkData = False
            msg = "Input parameter AlpacaSolvedModel failed to collect data"
            ghenv.Component.AddRuntimeMessage(gh.Kernel.GH_RuntimeMessageLevel.Warning, msg)
        else:
            try:
                fileId = Hdf5.OpenFile(AlpacaSolvedModel.recorderName, True)
                numberOfPoints = len(AlpacaSolvedModel.uniquePoints) #
                        
                        
                displacementResult = Hdf5.ReadObject[Steps](fileId, "/MODEL_STAGE[1]/RESULTS/ON_NODES/DISPLACEMENT/DATA")
                displacement = []
                rotation = []
                dispNodeList = []
                for i in range(numberOfPoints):
                    tag = i + 1
                    vx = getattr(displacementResult, 'STEP_{}'.format(step))[i,0]
                    vy = getattr(displacementResult, 'STEP_{}'.format(step))[i,1]
                    vz = getattr(displacementResult, 'STEP_{}'.format(step))[i,2]
                    trasl = rg.Vector3d(vx,vy,vz)
                    displacement.append(trasl)
                    dispNodeList.append( [tag, trasl] )
                    
                Hdf5.CloseFile(fileId)
                print("I have closed the file")
            
                dispNodeDict = dict( dispNodeList )
                #---------------------------------------------------#
                defEleVector1 = alpacaView.BeamVectorDef(AlpacaSolvedModel,dispNodeDict) #beam
                defEleVector2 = alpacaView.ShellVectorDef(AlpacaSolvedModel,dispNodeDict) #shell
                defEleVector3 = alpacaView.BrickVectorDef(AlpacaSolvedModel,dispNodeDict) #shell
                bound = alpacaView.boundsDef(displacement, typeColor)
                if self.extrudeModel == None or self.extrudeModel == False:
                    #BEAM
                    defModel1 = alpacaView.BeamDef(AlpacaSolvedModel, dispNodeDict,scale)
                    self.defModel1, self.beamColor = alpacaView.ColorBeamDef( defModel1, defEleVector1, bound, listColor, typeColor)
                    #SHELL
                    defModel2 = alpacaView.ShellDef(AlpacaSolvedModel,dispNodeDict,scale)
                    #BRICK
                    defModel3 = alpacaView.BrickDef(AlpacaSolvedModel,dispNodeDict,scale)
                else:
                    #BEAM
                    defModel1 = alpacaView.BeamDefExtrude(AlpacaSolvedModel, dispNodeDict,scale)
                    self.defModel1 = alpacaView.ColorBeamDefExtrude( defModel1, defEleVector1, bound, listColor, typeColor)
                    #SHELL
                    defModel2 = alpacaView.ShellDefExtrude(AlpacaSolvedModel,dispNodeDict,scale)
                    #BRICK
                    defModel3 = alpacaView.BrickDef(AlpacaSolvedModel,dispNodeDict,scale)
                    
                #SHELL COLOR
                self.defModel2 = alpacaView.ColorShellDef( defModel2, defEleVector2 , bound, listColor, typeColor, extrudeModel )
                #BRICK COLOR
                self.defModel3 = alpacaView.ColorBrickDef( defModel3, defEleVector3 , bound, listColor, typeColor)
                DefModel = th.list_to_tree(self.defModel1 + defModel2 + defModel3)
                bounds = ConstructDomain(bound[0], bound[1])
                return (DefModel, bounds)
            except:
                Hdf5.CloseFile(fileId)
                print("I have closed the file due to exception")
            # return outputs if you have them; here I try it for you:
        
        
    def DrawViewportWires(self,arg):
        for iMesh in self.defModel2 :
            colorWirframe = System.Drawing.Color.Black
            arg.Display.DrawMeshWires(iMesh, colorWirframe)
            
        for iMesh in self.defModel3 :
            colorWirframe = System.Drawing.Color.Black
            arg.Display.DrawMeshWires(iMesh, colorWirframe)
        if self.extrudeModel is None or self.extrudeModel is False:
            thickness =2
            for iBeam, iColor in zip(self.defModel1, self.beamColor) :
                for jBeam, jColor in zip(iBeam, iColor):
                    arg.Display.DrawCurve(jBeam, jColor, thickness)
        else:
            for iBeam in self.defModel1 :
                colorWirframe = System.Drawing.Color.Black
                arg.Display.DrawMeshWires(iBeam, colorWirframe)
# ---------- end dm ----------
mesh_5 = Mesh(dm.DefModel)
clean_3 = CombineClean(Meshes=mesh_5)
wbnaked_2 = WeaverbirdsNakedBoundary(MeshClosedPolylines=clean_3)
previewlw = CustomPreviewLineweights(Geometry=wbnaked_2, Shader=ColourSwatch(SwatchColor=RGB(0, 0, 0)), Absolute=False)

list_item = ListItem(Index=0, Wrap=True)  # -> Item, Item1
panel_4 = Panel("30")
random = Random(Range=Domain(0, 1), Number="20", Seed=2)
bool = Bool()
C = Color()
col_2 = Colour()
D = Domain()
col_3 = Colour(gradientlibrary_2)
lng_2 = ListLength(List=col_3)
data = Data(flatten(Tree({0;0}: [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], {0;1}: [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], {0;2}: [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], {0;3}: [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], {0;4}: [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], {0;5}: [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]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)))
number_slider_10 = Slider(3, range=1..20)
python = GhPythonScript(AlpacaLogo=data, bool=Toggle(True))  # -> out, curve; inputs AlpacaLogo: Curve, bool: Boolean
# ---------- python: Python ----------
__author__ = "Domen"
__version__ = "2021.04.17"


if bool is False:
    curve = None
else :
    curve = AlpacaLogo
# ---------- end python ----------
python_2 = GhPythonScript()  # -> out, ViewWidth, ViewHeight, scale
# ---------- python_2: Python ----------
import Rhino.ApplicationSettings.AppearanceSettings
import System
import scriptcontext


H = Rhino.RhinoDoc.ActiveDoc.Views.ActiveView.ActiveViewport.Bounds.Height 
ViewHeight = H*()
W = Rhino.RhinoDoc.ActiveDoc.Views.ActiveView.ActiveViewport.Bounds.Width
ViewWidth = W*()
#scale = 5 #ViewWidth*(1 - )
print(scale)

scale = 6
newViewport  = Rhino.RhinoDoc.ActiveDoc.Views.ActiveView.ActiveViewport
newViewport.ZoomExtents()
#Turn off grid
H = newViewport.Bounds.Height 
ViewHeight = H*(1 -(scale/2*0.3))
W = newViewport.Bounds.Width
ViewWidth = W*(1 -(scale/2*0.1))

scriptcontext.doc.Views.Redraw()
# ---------- end python_2 ----------
multiplication_2 = Multiplication(A=Slider(177, range=-1000..1000), B=number_slider_10)
division = Division(A=multiplication_2, B="2")
pt_8 = ConstructPoint(XCoordinate=python_2.ViewWidth, YCoordinate=python_2.ViewHeight, ZCoordinate=0)
X = UnitX(Factor=division)
rev = Reverse(Vector=X)
move_4 = Move(Geometry=pt_8, Motion=rev)  # -> Geometry, Transform
crvtoscreen = RenderCurveToScreen(
    Curve=python.curve,
    Location=move_4.Geometry,
    ScaleFactor=number_slider_10,
    Color=ColourSwatch(SwatchColor=RGB(10, 5, 5)),
    Thickness=1,
    Depth=0.95,
    Fixed=True,
    m_scWithvp=False)

dom_4 = ConstructDomain(DomainStart=Slider(0, range=0..100), DomainEnd=Slider(53, range=0..100))

python_3 = GhPythonScript()  # -> out, ViewWidth, ViewHeight, scale
# ---------- python_3: Python ----------
import Rhino.ApplicationSettings.AppearanceSettings
import System
import scriptcontext

newViewport  = Rhino.RhinoDoc.ActiveDoc.Views.ActiveView.ActiveViewport
newViewport.ZoomExtents()
#Turn off grid
H = newViewport.Bounds.Height 
ViewHeight = H*(1 - 0.1)
W = newViewport.Bounds.Width
ViewWidth = W*(1 - 0.19)
scale = ViewWidth*(1 - 0.96)

scriptcontext.doc.Views.Redraw()
# ---------- end python_3 ----------
python_4 = GhPythonScript(listColor=gradientlibrary_2, c="10")  # -> out, gradient_Mesh; inputs listColor: list of Color, c: Int32
# ---------- python_4: Python ----------
__author__ = "Domen"
__version__ = "2021.04.17"

import rhinoscriptsyntax as rs
import Rhino.Geometry as rg

if c is not None: c = 10

gradient_Mesh = rg.Mesh()
if listColor is not None:
    s = c/(len(listColor)-1)
    for i in range(len(listColor)):
        gradient_Mesh.Vertices.Add( rg.Point3d(i*s, 0, 0 ) )
        gradient_Mesh.Vertices.Add( rg.Point3d(i*s, 0.5, 0 ) )
        gradient_Mesh.VertexColors.Add( listColor[i] )
        gradient_Mesh.VertexColors.Add( listColor[i] )
        
    nF = len(listColor) -1
    for i in range(nF):
        gradient_Mesh.Faces.AddFace( i*2, i*2+1, i*2+3, i*2+2 )
# ---------- end python_4 ----------

multiplication_3 = Multiplication(A=python_3.scale, B="0.15")
multiplication_4 = Multiplication(A=python_3.scale, B="10")
pt_9 = ConstructPoint(XCoordinate=python_3.ViewWidth, YCoordinate=python_3.ViewHeight, ZCoordinate=0)
medges_2 = MeshEdges(Mesh=python_4.gradient_Mesh)  # -> NakedEdges, InteriorEdges, NonManifoldEdges
division_2 = Division(A=multiplication_4, B="2")
X_2 = UnitX(Factor=division_2)
rev_2 = Reverse(Vector=X_2)
move_5 = Move(Geometry=pt_9, Motion=rev_2)  # -> Geometry, Transform
multiplication_5 = Multiplication(A=python_3.scale, B="10")
X_3 = UnitX(Factor=multiplication_5)
move_6 = Move(Geometry=move_5.Geometry, Motion=X_3)  # -> Geometry, Transform
dist = Distance(PointA=move_5.Geometry, PointB=move_6.Geometry)
range = Range(Domain=dom_4, Steps=lng_2)  # -> expr("Round(x,2)", Range)
range_2 = Range(Domain=dist, Steps=lng_2)
division_3 = Division(A=python_3.scale, B="2.5")
vec_2 = VectorXYZ(XComponent=range_2, YComponent=division_3, ZComponent=0)  # -> Vector, Length
addition_3 = Addition(A=move_5.Geometry, B=vec_2.Vector)
vec_3 = VectorXYZ(XComponent=multiplication_3, YComponent=0, ZComponent=0)  # -> Vector, Length
subtraction_2 = Subtraction(A=addition_3, B=vec_3.Vector)
crvtoscreen_2 = RenderCurveToScreen(
    Curve=[medges_2.NakedEdges, medges_2.InteriorEdges],
    Location=move_5.Geometry,
    ScaleFactor=python_3.scale,
    Color=swatch,
    Thickness=1,
    Depth=0.95,
    Fixed=True,
    m_scWithvp=False)
meshtoscreen = RenderMeshToScreen(
    Mesh=python_4.gradient_Mesh,
    Location=move_5.Geometry,
    ScaleFactor=python_3.scale,
    Depth=0.95,
    Fixed=True,
    m_scWithvp=False)
texttoscreen = RenderTextToScreen(Text=range, Location=subtraction_2, Size=multiplication_3, Color=swatch, Font="Iosevka", m_scWithvp=False)
