# Grasshopper definition PalazzinaConControventi.gh (Grasshopper 1.0.7)
# plug-ins: Kangaroo2 Components, T-Rex

# ---- group: dimensioni della pianta
# Parametri variabili
dim_x = Slider(60, range=0..100)
dim_y = Slider(60, range=0..100)

# ---- group: angolo twisting
angolo_max = Slider(0, range=0..360)

# ---- group: interassi travi
int_y = Slider(5, range=0..100)
int_x = Slider(5, range=0..100)

# ---- group: numero piani
n_piani = Slider(8, range=0..8)

# ---- group: int Z
panel = Panel("4")

# ---- group: Element
data = Data(0)
data_2 = Data(0)

# ---- group: Load
# instagram:    Alpaca4d
# facebook:     Alpaca4d
# mail:         alpaca4d@gmail.com
data_3 = Data(0)
data_4 = Data(0)

# ----
rectangle = Rectangle(Plane=PlaneXY(0, 0, 0), XSize=dim_x, YSize=dim_y, Radius=0)  # -> Rectangle, Length

# ---- group: Cross-Section
data_5 = Data(0)
data_6 = Data(0)

# ---- group: Support
data_7 = Data(0)
data_8 = Data(0)

# ---- group: Constraint
data_9 = Data(0)
data_10 = Data(0)

# ---- group: Material
data_11 = Data(0)
data_12 = Data(0)

# ----
mesh_uv = MeshSurface(Surface=rectangle.Rectangle, UCount=int_y, VCount=int_x, Overhang=True, Equalize=False)

# ---- group: import mesh da Rhino
data_13 = Data()

# ----
series = Series(Start=0, Step=panel, Count=n_piani)
Z = UnitZ(Factor=series)
move = Move(Geometry=mesh_uv, Motion=Z)  # -> Geometry, Transform
lng = ListLength(List=move.Geometry)
dom = ConstructDomain(DomainStart=0, DomainEnd=angolo_max)
area = Area(Geometry=move.Geometry)  # -> Area, Centroid
range = Range(Domain=dom, Steps=expr("x-1", lng))
xy = XYPlane(Origin=area.Centroid)
rad = Radians(Degrees=range)
rotate = Rotate(Geometry=move.Geometry, Angle=rad, Plane=xy)  # -> Geometry, Transform

# ----
# quote
explode = Explode(Curve=rectangle.Rectangle, Recursive=True)  # -> Segments, Vertices
item = ListItem(List=explode.Segments, Index=0, Wrap=True)  # -> Item, Item1
division = Division(A=dim_x, B="2")
X = UnitX(Factor=division)
neg = Negative(Value=X)
area_2 = Area(Geometry=rotate.Geometry)  # -> Area, Centroid
divide = DivideCurve(Curve=item.Item, Count=int_y, Kinks=False)  # -> Points, Tangents, Parameters
divide_2 = DivideCurve(Curve=item.Item1, Count=int_x, Kinks=False)  # -> Points, Tangents, Parameters
move_2 = Move(Geometry=area_2.Centroid, Motion=neg)  # -> Geometry, Transform
pline = PolyLine(Vertices=divide_2.Points, Closed=False)
pline_2 = PolyLine(Vertices=move_2.Geometry, Closed=False)
end = EndPoints(Curve=pline)  # -> Start, End
pline_3 = PolyLine(Vertices=divide.Points, Closed=False)
end_2 = EndPoints(Curve=pline_3)  # -> Start, End
explode_2 = Explode(Curve=pline, Recursive=True)  # -> Segments, Vertices
explode_3 = Explode(Curve=pline_2, Recursive=True)  # -> Segments, Vertices
explode_4 = Explode(Curve=pline_3, Recursive=True)  # -> Segments, Vertices
end_3 = EndPoints(Curve=explode_2.Segments)  # -> Start, End
end_4 = EndPoints(Curve=pline_2)  # -> Start, End
end_5 = EndPoints(Curve=explode_3.Segments)  # -> Start, End
end_6 = EndPoints(Curve=explode_4.Segments)  # -> Start, End
number_slider = Slider(10, range=0..10)
item_2 = ListItem(List=move_2.Geometry, Index=0, Wrap=True)
item_3 = ListItem(List=move_2.Geometry, Index=0, Wrap=True)
neg_2 = Negative(Value=Slider(2.5, range=0..10))
neg_3 = Negative(Value=Slider(2.5, range=0..10))
neg_4 = Negative(Value=Slider(5, range=0..10))
multiplication = Multiplication(A=number_slider, B=Slider(1.4, range=0..10))
xz = XZPlane(Origin=item_2)
xz_2 = XZPlane(Origin=item_3)
aligndim = AlignedDimension(Plane=xz, PointA=end_4.Start, PointB=end_4.End, Offset=multiplication, Text="{0:0.00}", Size="0.5")
aligndim_2 = AlignedDimension(Plane=xz_2, PointA=end_5.Start, PointB=end_5.End, Offset=number_slider, Text="{0:0.00}", Size="0.5")
aligndim_3 = AlignedDimension(
    Plane=PlaneXY(0, 0, 0),
    PointA=[end_2.Start, end.Start],
    PointB=[end_2.End, end.End],
    Offset=neg_4,
    Text="{0:0.00}",
    Size="0.5")
aligndim_4 = AlignedDimension(Plane=PlaneXY(0, 0, 0), PointA=end_6.Start, PointB=end_6.End, Offset=neg_2, Text="{0:0.00}", Size="0.5")
aligndim_5 = AlignedDimension(Plane=PlaneXY(0, 0, 0), PointA=end_3.Start, PointB=end_3.End, Offset=neg_3, Text="{0:0.00}", Size="0.5")

cull_i = CullIndex(List=rotate.Geometry, Indices="0", Wrap=True)
demesh = DeconstructMesh(Mesh=rotate.Geometry)  # -> Vertices, Faces, Colours, Normals

# ----
# Travi
medges = MeshEdges(Mesh=cull_i)  # -> NakedEdges, InteriorEdges, NonManifoldEdges
unit = UnitVector(Vector=medges.InteriorEdges)
abs = Absolute(Value=unit)
devec = DeconstructVector(Vector=abs)  # -> XComponent, YComponent, ZComponent
equals = Equality(FirstNumber=devec.XComponent, SecondNumber="1")  # -> Equality, Inequality
dispatch = Dispatch(List=medges.InteriorEdges, DispatchPattern=equals.Equality)  # -> ListA, ListB

# ----
# Colonne
flip = FlipMatrix(Data=demesh.Vertices)
pline_4 = PolyLine(Vertices=flip, Closed=False)
explode_5 = Explode(Curve=pline_4, Recursive=True)  # -> Segments, Vertices
flip_2 = FlipMatrix(Data=explode_5.Segments)

viewer = ParamViewer(demesh.Vertices)
viewer_2 = ParamViewer(demesh.Vertices)

# ---- group: colonne
data_14 = Data(flatten(flip_2))

# ---- group: orditura Y
data_15 = Data(dispatch.ListB)

# ---- group: orditura X
data_16 = Data(dispatch.ListA)

# ---- group: travi di Bordo
data_17 = Data(medges.NakedEdges)

# ----
tstat = TreeStatistics(Tree=demesh.Vertices)  # -> Paths, Length, Count
item_4 = ListItem(List=tstat.Paths, Index=0, Wrap=True)
split = SplitTree(Data=demesh.Vertices, Masks=flatten(item_4))  # -> Positive, Negative
data_18 = Data(simplify(split.Negative))

# ---- group: Master Node
avr = Average(Input=data_18)

# ---- group: support
data_19 = Data(split.Positive)

# ---- group: Controventi
graft = GraftTree(Tree=rotate.Geometry, IncludeEmptyLists=True, IncludeNullItems=True)
medges_2 = MeshEdges(Mesh=graft)  # -> NakedEdges, InteriorEdges, NonManifoldEdges
join = JoinCurves(Curves=medges_2.NakedEdges, Preserve=False)
explode_6 = Explode(Curve=join, Recursive=True)  # -> Segments, Vertices
flip_3 = FlipMatrix(Data=explode_6.Vertices)
pline_5 = PolyLine(Vertices=flip_3, Closed=False)  # -> flatten(Polyline)
item_5 = ListItem(List=pline_5, Index=Slider(5, range=0..10), Wrap=True)  # -> Item, Item1
explode_7 = Explode(Curve=item_5.Item1, Recursive=True)  # -> Segments, Vertices
explode_8 = Explode(Curve=item_5.Item, Recursive=True)  # -> Segments, Vertices
# I
#  I
#  I
#  I
entwine = Entwine(Branch00=explode_8.Segments, Branch01=explode_7.Segments, FlattenInputs=True)
flip_4 = FlipMatrix(Data=entwine)
loft = Loft(Curves=flip_4, Options={Adjust=False, Closed=False, LoftEnds=0, LoftSimp=0, LoftType=0, Rebuild=10, Refit=0.01})
smesh = SimpleMesh(Brep=loft)
demesh_2 = DeconstructMesh(Mesh=smesh)  # -> Vertices, Faces, Colours, Normals
item_6 = ListItem(List=demesh_2.Vertices, Index=0, Wrap=True)  # -> Item, Item1, Item2, Item3
ln = Line(StartPoint=item_6.Item, EndPoint=item_6.Item2)
ln_2 = Line(StartPoint=item_6.Item1, EndPoint=item_6.Item3)
merge = Merge(Data1=ln, Data2=ln_2)  # -> simplify(Result)

# ----
cluster = Cluster(T=rotate.Geometry, i=Slider(16, range=12..16))  # -> flatten(R)
cluster_2 = Cluster(T=rotate.Geometry, i=Slider(2, range=2..6))  # -> flatten(R); disabled
# V
merge_2 = Merge(Data1=cluster_2, Data2=cluster)
division_2 = Division(A=panel, B="1")

# ---- group: da MPa a KN/m2
multiplication_2 = Multiplication(A=Slider(30000, range=0..100000), B="1000")

# ----
addition = Addition(A="0.3", B="2")
division_3 = Division(A=multiplication_2, B=addition)
division_4 = Division(A="25", B="9.81")
uem = UniaxialElasticMaterialAlpaca4d(E=multiplication_2, G=division_3, v="0.3", rho=division_4)  # -> out, uniAxialMaterial
# ---------- uem: Python ----------
"""
Create a uniaxial Elastic Material
-
    Args:
        E:
        Eneg:
        eta:
        G:
        v:
        rho:
    Returns:
        uniAxialMaterial:
"""

ghenv.Component.Name = "uniaxial Elastic Material (Alpaca4d)"
ghenv.Component.NickName = 'UEM'
ghenv.Component.Message = "uniaxial Elastic (Alpaca4d)"

import sys
import Rhino.Geometry as rg
import Grasshopper as gh
import copy


## add alpaca install directory to system path

ghcompfolder = gh.Folders.DefaultAssemblyFolder
if ghcompfolder not in sys.path:
    sys.path.append(ghcompfolder)

try:
    from Alpaca4d import alpaca4d as alpaca
except:
    msg = "Cannot import Alpaca4d. Is the Alpaca4d folder available in " + ghcompfolder + "?"
    ghenv.Component.AddRuntimeMessage(gh.Kernel.GH_RuntimeMessageLevel.Error, msg)


checkData = True

if not E:
    checkData = False
    msg = "Input parameter E failed to collect data"
    ghenv.Component.AddRuntimeMessage(gh.Kernel.GH_RuntimeMessageLevel.Warning, msg)

if not G and not v:
    checkData = False
    msg = "Input parameter G or v failed to collect data"
    ghenv.Component.AddRuntimeMessage(gh.Kernel.GH_RuntimeMessageLevel.Warning, msg)

if not rho:
    checkData = False
    msg = "Input parameter rho failed to collect data"
    ghenv.Component.AddRuntimeMessage(gh.Kernel.GH_RuntimeMessageLevel.Warning, msg)



if checkData:
    uniAxialMaterial = alpaca.uniAxialMaterialElastic(name, E, Eneg, eta, G, v, rho)
# ---------- end uem ----------

merge_3 = Merge(Data2=data_17)

# ---- group: Load
area_3 = Area(Geometry=mesh_uv)  # -> Area, Centroid
python = GhPythonScript(constantFactor="1")  # -> timeSeries, Graph
# ---------- python: Python ----------
"""
Create a PointLoad
-
    Args:
        tStart:
        tEnd:
        period:
        factor:
        shift:
    Returns:
        timeSeries:
        Graph:
"""

import sys
import Rhino.Geometry as rg
import Grasshopper as gh
import copy
import math


## add alpaca install directory to system path

ghcompfolder = gh.Folders.DefaultAssemblyFolder
if ghcompfolder not in sys.path:
    sys.path.append(ghcompfolder)

try:
    from Alpaca4d import alpaca4d as alpaca
except:
    msg = "Cannot import Alpaca4d. Is the Alpaca4d folder available in " + ghcompfolder + "?"
    ghenv.Component.AddRuntimeMessage(gh.Kernel.GH_RuntimeMessageLevel.Error, msg)

def ConstantSeries(x):
    return x



checkData = True

if not constantFactor:
    constantFactor = 1


if checkData:
    timeSeries = alpaca.TimeSeriesConstant(constantFactor)
    
    Graph = []
    
    for x in range(10):
        Graph.append(ConstantSeries(constantFactor))
# ---------- end python ----------
lng_2 = ListLength(List=data_19)
division_5 = Division(A=area_3.Area, B=lng_2)
multiplication_3 = Multiplication(A="-10", B=division_5)
abs_2 = Absolute(Value=multiplication_3)
multiplication_4 = Multiplication(A=abs_2, B="0.05")
vec = VectorXYZ(XComponent=multiplication_4, YComponent=0, ZComponent=multiplication_3)  # -> Vector, Length
duppt = RemoveDuplicatePts(Points=data_18, Tolerance=0.01)
pl = PointLoadAlpaca4d(Pos=duppt, Force=vec.Vector, TimeSeries=python.timeSeries)  # -> out, Load; inputs Pos: Point3d, Force: Vector3d, Moment: Vector3d
# ---------- pl: Python ----------
"""
Create a Point Load
-
    Args:
        Pos:
        Force:
        Moment:
        TimeSeries:
    Returns:
        PointLoad:
"""

ghenv.Component.Name = "Point Load (Alpaca4d)"
ghenv.Component.NickName = 'PL'
ghenv.Component.Message = "Point Load (Alpaca4d)"



import sys
import Rhino.Geometry as rg
import Grasshopper as gh
import copy


## add alpaca install directory to system path

ghcompfolder = gh.Folders.DefaultAssemblyFolder
if ghcompfolder not in sys.path:
    sys.path.append(ghcompfolder)

try:
    from Alpaca4d import alpaca4d as alpaca
except:
    msg = "Cannot import Alpaca4d. Is the Alpaca4d folder available in " + ghcompfolder + "?"
    ghenv.Component.AddRuntimeMessage(gh.Kernel.GH_RuntimeMessageLevel.Error, msg)


checkData = True

if not Pos:
    checkData = False
    msg = "Input parameter Pos failed to collect data"
    ghenv.Component.AddRuntimeMessage(gh.Kernel.GH_RuntimeMessageLevel.Warning, msg)

if not Force:
    Force = rg.Vector3d(0,0,0)

if not Moment:
    Moment = rg.Vector3d(0,0,0)

if not TimeSeries:
    checkData = False
    msg = "Input parameter TimeSeries failed to collect data"
    ghenv.Component.AddRuntimeMessage(gh.Kernel.GH_RuntimeMessageLevel.Warning, msg)


if checkData:
    Load = alpaca.PointLoad(Pos, Force, Moment, TimeSeries)
# ---------- end pl ----------
pl_2 = PointLoadAlpaca4d(Pos=avr, Force=vec.Vector, TimeSeries=python.timeSeries)  # -> out, Load; inputs Pos: Point3d, Force: Vector3d, Moment: Vector3d; same code as pl

# ----
toggle = BooleanToggle(True)
toggle_2 = BooleanToggle(True)
support = SupportAlpaca4d(Pos=avr, Tx=False, Ty=False, Tz=Toggle(True), Rx=toggle, Ry=toggle, Rz=False)  # -> Support; inputs Pos: Point3d, Tx: Boolean, Ty: Boolean, Tz: Boolean, Rx: Boolean, Ry: Boolean, Rz: Boolean
# ---------- support: Python ----------
"""
Create a support
-
    Args:
        Pos:
        Tx:
        Ty:
        Tz:
        Rx:
        Ry:
    Returns:
        Support:
"""

ghenv.Component.Name = "Support (Alpaca4d)"
ghenv.Component.NickName = 'Support'
ghenv.Component.Message = "Support (Alpaca4d)"


import sys
import Rhino.Geometry as rg
import Grasshopper as gh


## add alpaca install directory to system path

ghcompfolder = gh.Folders.DefaultAssemblyFolder
if ghcompfolder not in sys.path:
    sys.path.append(ghcompfolder)

try:
    from Alpaca4d import alpaca4d as alpaca
except:
    msg = "Cannot import Alpaca4d. Is the Alpaca4d folder available in " + ghcompfolder + "?"
    ghenv.Component.AddRuntimeMessage(gh.Kernel.GH_RuntimeMessageLevel.Error, msg)

checkData = True


if not Pos:
    checkData = False
    msg = "Input parameter Pos failed to collect data"
    ghenv.Component.AddRuntimeMessage(gh.Kernel.GH_RuntimeMessageLevel.Warning, msg)

if checkData:
    Support = alpaca.Support(Pos, Tx, Ty, Tz, Rx, Ry, Rz)
# ---------- end support ----------
support_2 = SupportAlpaca4d(Pos=data_19, Tx=toggle_2, Ty=toggle_2, Tz=toggle_2, Rx=toggle_2, Ry=toggle_2, Rz=toggle_2)  # -> Support; inputs Pos: Point3d, Tx: Boolean, Ty: Boolean, Tz: Boolean, Rx: Boolean, Ry: Boolean, Rz: Boolean; same code as support

rd = RigidDiaphgramAlpaca4d(masterNode=avr, slaveNodes=data_18)  # -> out, Constraint; inputs masterNode: Point3d, slaveNodes: list of Point3d
# ---------- rd: Python ----------
"""
Create a Diaphgram
-
    Args:
        masterNode:
        slaveNodes:
    Returns:
        Constraint:
"""


import sys
import Rhino.Geometry as rg
import Grasshopper as gh
import copy
from System.Drawing import Color


ghenv.Component.Name = "Rigid Diaphgram (Alpaca4d)"
ghenv.Component.NickName = 'RD'
ghenv.Component.Message = 'Rigid Diaphgram (Alpaca4d)'

## add alpaca install directory to system path

ghcompfolder = gh.Folders.DefaultAssemblyFolder
if ghcompfolder not in sys.path:
    sys.path.append(ghcompfolder)

try:
    from Alpaca4d import alpaca4d as alpaca
except:
    msg = "Cannot import Alpaca4d. Is the Alpaca4d folder available in " + ghcompfolder + "?"
    ghenv.Component.AddRuntimeMessage(gh.Kernel.GH_RuntimeMessageLevel.Error, msg)


checkData = True

if not masterNode:
    checkData = False
    msg = "Input parameter masterNode failed to collect data"
    ghenv.Component.AddRuntimeMessage(gh.Kernel.GH_RuntimeMessageLevel.Warning, msg)

if not slaveNodes:
    checkData = False
    msg = "Input parameter slaveNodes failed to collect data"
    ghenv.Component.AddRuntimeMessage(gh.Kernel.GH_RuntimeMessageLevel.Warning, msg)


if checkData:
    Constraint = alpaca.RigidDiaphragm(masterNode, slaveNodes)
# ---------- end rd ----------
as = AnalysisSettingsAlpaca4d(AnalysisSteps="1")  # -> Settings
# ---------- as: Python ----------
"""
Create Analysis settings
-
    Args:
        Constraint: 'Plain', 'Transformation'. Default is 'Transformation'.
        Numberer: 'RCM', 'AMD', 'Plain'. Default is 'RCM'.
        System: 'BandGen', 'BandSPD', 'ProfileSPD', 'SuperLU', 'UmfPack', 'FullGeneral', 'SparseSYM'. Default is 'BandSPD'.
        Test: Feature not implemented. Please contact alpaca4d@gmail.com 
        Algorithm: 'Linear', 'Newton', 'NewtonLineSearch', 'ModifiedNewton', 'KrylovNewton', 'SecantNewton', 'BFGS', 'Broyden'. Default is 'Linear'.
        Integrator: Default is LoadControl.
        AnalysisType: 'Static', 'Transient'. Default is 'Static'.
        AnalyesSteps:
    Returns:
        Analysis:
"""

import sys
import os


import clr
import clrtype
import Rhino.Geometry as rg
import rhinoscriptsyntax as rs
import Grasshopper as gh
import copy
import ghpythonlib.treehelpers as th


ghenv.Component.Name = "Analysis settings (Alpaca4d)"
ghenv.Component.NickName = 'AS'
ghenv.Component.Message = "Analysis settings \n(Alpaca4d)"



from Alpaca4d import alpaca4d as alpaca

checkData = True


# default Value
Constraint = 'Transformation' if Constraint is None else Constraint
ConstraintList = ['Plain', 'Transformation']

for item in ConstraintList:
    if Constraint.lower() == item.lower():
        print(item)
        Constraint = item


# default Value
Numberer = 'RCM' if Numberer is None else Numberer
NumbererList = ['RCM', 'AMD', 'Plain', 'ParallelPlain', 'ParallelRCM']

for i,item in enumerate(NumbererList):
    if Numberer.lower() == item.lower():
        Numberer = item



# default Value
System = 'BandSPD' if System is None else System
SystemList = ['BandGen', 'BandSPD', 'ProfileSPD', 'SuperLU', 'UmfPack', 'FullGeneral', 'SparseSYM']

for i,item in enumerate(SystemList):
    if System.lower() == item.lower():
        System = item


# default Test
Test = 'NormDispIncr 1.0e-6 12 5' if Test is None else Test




# default Value
Algorithm = 'Linear' if Algorithm is None else Algorithm
AlgorithmList = ['Linear', 'Newton', 'NewtonLineSearch', 'ModifiedNewton', 'KrylovNewton', 'SecantNewton', 'BFGS', 'Broyden']

for i,item in enumerate(AlgorithmList):
    if Algorithm.lower() == item.lower():
        Algorithm = item


# default Value
AnalysisType = 'Static' if AnalysisType is None else AnalysisType
AnalysisTypeList = ['Static', 'Transient']

for item in AnalysisTypeList:
    if AnalysisType.lower() == item.lower():
        AnalysisType = item


## Define Integrator
if AnalysisType == "Static":
    Integrator = "LoadControl 1.0" if Integrator is None else Integrator
elif AnalysisType == "Transien":
    Integrator = "Newmark 0.5 0.25" if Integrator is None else Integrator



if not AnalysisSteps:
    checkData = False
    msg = "Input parameter AnalysisSteps failed to collect data"
    ghenv.Component.AddRuntimeMessage(gh.Kernel.GH_RuntimeMessageLevel.Warning, msg)


if checkData:
    Settings = alpaca.Analysis(Constraint, Numberer,System,Test,Algorithm,Integrator,AnalysisType, AnalysisSteps)
    print(Settings.write_tcl())
# ---------- end as ----------
gradientlibrary = GradientLibrary(gradIndex=Slider(1, range=1..12))  # -> colors; inputs gradIndex: Int32
#   port colors: A series of colors to be plugged into the "Ladybug_Legend Parameters" component.
# ---------- gradientlibrary: Python ----------
"""
Preset of gradient colors perfect for Data Visualisation
    Inputs:
        gradIndex: An index refering to one of the following possible gradients:
            0 - Orignal Ladybug
            1 - Nuanced Ladybug
            2 - Multi-colored Ladybug
            3 - Ecotect
            4 - Thermal Comfort Percentage
            5 - Thermal Comfort Colors
            6 - Shade Benefit/Harm
            7 - Shade Harm
            8 - Shade Benefit
            9 - CFD Colors 1
            10 - Radiation Benefit
            11 - Gsa10 Colour
            12 - Gsa9 Colour
    Returns:
        customColors: A series of colors.
"""

ghenv.Component.Name = "Gradient Library"
ghenv.Component.NickName = 'GradientLibrary'
#ghenv.Component.Message = 'GradientLibrary\nWIP'

import scriptcontext as sc
import Grasshopper.Kernel as gh
import System

gradientLibrary = {
        0: [System.Drawing.Color.FromArgb(75, 107, 169), System.Drawing.Color.FromArgb(115, 147, 202), System.Drawing.Color.FromArgb(170, 200, 247), System.Drawing.Color.FromArgb(193, 213, 208), System.Drawing.Color.FromArgb(245, 239, 103), System.Drawing.Color.FromArgb(252, 230, 74), System.Drawing.Color.FromArgb(239, 156, 21), System.Drawing.Color.FromArgb(234, 123, 0), System.Drawing.Color.FromArgb(234, 74, 0), System.Drawing.Color.FromArgb(234, 38, 0)],
        1: [System.Drawing.Color.FromArgb(49,54,149), System.Drawing.Color.FromArgb(69,117,180), System.Drawing.Color.FromArgb(116,173,209), System.Drawing.Color.FromArgb(171,217,233), System.Drawing.Color.FromArgb(224,243,248), System.Drawing.Color.FromArgb(255,255,191), System.Drawing.Color.FromArgb(254,224,144), System.Drawing.Color.FromArgb(253,174,97), System.Drawing.Color.FromArgb(244,109,67), System.Drawing.Color.FromArgb(215,48,39), System.Drawing.Color.FromArgb(165,0,38)],
        2: [System.Drawing.Color.FromArgb(4,25,145), System.Drawing.Color.FromArgb(7,48,224), System.Drawing.Color.FromArgb(7,88,255), System.Drawing.Color.FromArgb(1,232,255), System.Drawing.Color.FromArgb(97,246,156), System.Drawing.Color.FromArgb(166,249,86), System.Drawing.Color.FromArgb(254,244,1), System.Drawing.Color.FromArgb(255,121,0), System.Drawing.Color.FromArgb(239,39,0), System.Drawing.Color.FromArgb(138,17,0)],
        3: [System.Drawing.Color.FromArgb(0,0,255), System.Drawing.Color.FromArgb(53,0,202), System.Drawing.Color.FromArgb(107,0,148), System.Drawing.Color.FromArgb(160,0,95), System.Drawing.Color.FromArgb(214,0,41), System.Drawing.Color.FromArgb(255,12,0), System.Drawing.Color.FromArgb(255,66,0), System.Drawing.Color.FromArgb(255,119,0), System.Drawing.Color.FromArgb(255,173,0), System.Drawing.Color.FromArgb(255,226,0), System.Drawing.Color.FromArgb(255,255,0)],
        4: [System.Drawing.Color.FromArgb(0,0,0), System.Drawing.Color.FromArgb(110,0,153), System.Drawing.Color.FromArgb(255,0,0), System.Drawing.Color.FromArgb(255,255,102), System.Drawing.Color.FromArgb(255,255,255)],
        5: [System.Drawing.Color.FromArgb(0,136,255), System.Drawing.Color.FromArgb(200,225,255), System.Drawing.Color.FromArgb(255,255,255), System.Drawing.Color.FromArgb(255,230,230), System.Drawing.Color.FromArgb(255,0,0)],
        6: [System.Drawing.Color.FromArgb(5,48,97), System.Drawing.Color.FromArgb(33,102,172), System.Drawing.Color.FromArgb(67,147,195), System.Drawing.Color.FromArgb(146,197,222), System.Drawing.Color.FromArgb(209,229,240), System.Drawing.Color.FromArgb(255,255,255), System.Drawing.Color.FromArgb(253,219,199), System.Drawing.Color.FromArgb(244,165,130), System.Drawing.Color.FromArgb(214,96,77), System.Drawing.Color.FromArgb(178,24,43), System.Drawing.Color.FromArgb(103,0,31)],
        7: [System.Drawing.Color.FromArgb(255,255,255), System.Drawing.Color.FromArgb(253,219,199), System.Drawing.Color.FromArgb(244,165,130), System.Drawing.Color.FromArgb(214,96,77), System.Drawing.Color.FromArgb(178,24,43), System.Drawing.Color.FromArgb(103,0,31)],
        8: [System.Drawing.Color.FromArgb(255,255,255), System.Drawing.Color.FromArgb(209,229,240), System.Drawing.Color.FromArgb(146,197,222), System.Drawing.Color.FromArgb(67,147,195), System.Drawing.Color.FromArgb(33,102,172), System.Drawing.Color.FromArgb(5,48,97)],
        9: [System.Drawing.Color.FromArgb(0,16,120), System.Drawing.Color.FromArgb(38,70,160), System.Drawing.Color.FromArgb(5,180,222), System.Drawing.Color.FromArgb(16,180,109), System.Drawing.Color.FromArgb(59,183,35), System.Drawing.Color.FromArgb(143,209,19), System.Drawing.Color.FromArgb(228,215,29), System.Drawing.Color.FromArgb(246,147,17), System.Drawing.Color.FromArgb(243,74,0), System.Drawing.Color.FromArgb(255,0,0)],
        10: [System.Drawing.Color.FromArgb(0,191,48), System.Drawing.Color.FromArgb(255,238,184), System.Drawing.Color.FromArgb(255,0,0)],
        11: [System.Drawing.Color.FromArgb(204,0,71), System.Drawing.Color.FromArgb(255,182,71), System.Drawing.Color.FromArgb(206,255,115), System.Drawing.Color.FromArgb(26,180, 214),System.Drawing.Color.FromArgb(0,0,207)],
        12: [System.Drawing.Color.FromArgb(255, 51, 51), System.Drawing.Color.FromArgb(255, 170, 51), System.Drawing.Color.FromArgb(255, 255, 51), System.Drawing.Color.FromArgb(170, 255, 125), System.Drawing.Color.FromArgb(51, 255, 231), System.Drawing.Color.FromArgb(51, 170, 255), System.Drawing.Color.FromArgb(51,51, 255)]}
colors = gradientLibrary[gradIndex]
# ---------- end gradientlibrary ----------
num = Number("15e-0")
number_slider_2 = Slider(2, range=0..10)  # disabled
number_slider_3 = Slider(0.3, range=0..1)  # disabled
toggle_3 = BooleanToggle(False)  # disabled
multiplication_5 = Multiplication(A=panel, B=n_piani)  # disabled
panel_2 = Panel("300")  # disabled
division_6 = Division(A=multiplication_5, B=panel_2)  # disabled

lng_3 = ListLength(List=data_14)
division_7 = Division(A=lng_3, B=Slider(6, range=0..10))
dom_2 = ConstructDomain(DomainStart="0.5", DomainEnd="0.5")

# ---- group: colonne
partition = PartitionList(List=data_14, Size=division_7)

# ----
tstat_2 = TreeStatistics(Tree=partition)  # -> Paths, Length, Count
range_2 = Range(Domain=dom_2, Steps=expr("x-1", tstat_2.Count))

# ---- group: sezione colonne
graft_2 = GraftTree(Tree=range_2, IncludeEmptyLists=True, IncludeNullItems=True)

# ----
midpt = CurveMiddle(Curve=merge_2)
pdecon = Deconstruct(Point=midpt)  # -> XComponent, YComponent, ZComponent
sort = SortList(Keys=pdecon.ZComponent, ValuesA=merge_2)  # -> Keys, ValuesA
number_slider_4 = Slider(6, range=0..10)
dom_3 = ConstructDomain(DomainStart="0.1", DomainEnd="0.01")

# ---- group: colonne
data_20 = Data(flatten(sort.ValuesA))

# ----
lng_4 = ListLength(List=data_20)
division_8 = Division(A=lng_4, B=division_2)
partition_2 = PartitionList(List=data_20, Size=division_8)
tstat_3 = TreeStatistics(Tree=partition_2)  # -> Paths, Length, Count
range_3 = Range(Domain=dom_3, Steps=expr("x-1", tstat_3.Count))
graft_3 = GraftTree(Tree=range_3, IncludeEmptyLists=True, IncludeNullItems=True)

division_9 = Division(A=graft_2, B="2")
gs = GenericSectionAlpaca4d(
    Area=graft_3,
    Izz="0.0000000001",
    Iyy="0.0000000001",
    J="0.0000000001",
    alphaY="0.5",
    alphaZ="0.5",
    material=uem.uniAxialMaterial)  # -> out, Section
# ---------- gs: Python ----------
"""
Create a Generic Cross Section
-
    Args:
        secName:
        Area:
        Izz:
        Iyy:
        J:
        alphaY:
        alphaZ:
        material:
    Returns:
        genericSection:
"""

ghenv.Component.Name = "Generic Section (Alpaca4d)"
ghenv.Component.NickName = 'GS'
ghenv.Component.Message = "Generic Section (Alpaca4d)"

import sys
import Rhino.Geometry as rg
import Grasshopper as gh
import copy
import math as mt


## add alpaca install directory to system path

ghcompfolder = gh.Folders.DefaultAssemblyFolder
if ghcompfolder not in sys.path:
    sys.path.append(ghcompfolder)

try:
    from Alpaca4d import alpaca4d as alpaca
except:
    msg = "Cannot import Alpaca4d. Is the Alpaca4d folder available in " + ghcompfolder + "?"
    ghenv.Component.AddRuntimeMessage(gh.Kernel.GH_RuntimeMessageLevel.Error, msg)


checkData = True

if not Area:
    checkData = False
    msg = "Input parameter Area failed to collect data"
    ghenv.Component.AddRuntimeMessage(gh.Kernel.GH_RuntimeMessageLevel.Warning, msg)

if not Izz:
    checkData = False
    msg = "Input parameter Izz failed to collect data"
    ghenv.Component.AddRuntimeMessage(gh.Kernel.GH_RuntimeMessageLevel.Warning, msg)

if not Iyy:
    checkData = False
    msg = "Input parameter Iyy failed to collect data"
    ghenv.Component.AddRuntimeMessage(gh.Kernel.GH_RuntimeMessageLevel.Warning, msg)

if not J:
    checkData = False
    msg = "Input parameter J failed to collect data"
    ghenv.Component.AddRuntimeMessage(gh.Kernel.GH_RuntimeMessageLevel.Warning, msg)

if not alphaY:
    checkData = False
    msg = "Input parameter alphaY failed to collect data"
    ghenv.Component.AddRuntimeMessage(gh.Kernel.GH_RuntimeMessageLevel.Warning, msg)

if not alphaZ:
    checkData = False
    msg = "Input parameter alphaZ failed to collect data"
    ghenv.Component.AddRuntimeMessage(gh.Kernel.GH_RuntimeMessageLevel.Warning, msg)

if not material:
    checkData = False
    msg = "Input parameter material failed to collect data"
    ghenv.Component.AddRuntimeMessage(gh.Kernel.GH_RuntimeMessageLevel.Warning, msg)




if checkData:
    Section = alpaca.ElasticSection(secName, Area, Izz, Iyy, J, alphaY, alphaZ, material)
    d = 2*mt.sqrt(Area/mt.pi)
    Section.crv = rg.Circle(rg.Plane.WorldXY, d).ToNurbsCurve( 2, 10 )
    Section.sectionBrep = rg.Brep.CreatePlanarBreps( Section.crv, 0.1 )[0]
# ---------- end gs ----------
cs = CircularSectionAlpaca4d(d=graft_2, t=division_9, material=uem.uniAxialMaterial)  # -> out, Section
# ---------- cs: Python ----------
"""
Create a Circle Cross Section
-
    Args:
        secName:
        Area:
        Izz:
        Iyy:
        J:
        alphaY:
        alphaZ:
        material:
    Returns:
        genericSection:
"""

ghenv.Component.Name = "Circular Section (Alpaca4d)"
ghenv.Component.NickName = 'CS'
ghenv.Component.Message = "Circular Section (Alpaca4d)"

import sys
import Rhino.Geometry as rg
import Grasshopper as gh
import copy


## add alpaca install directory to system path

ghcompfolder = gh.Folders.DefaultAssemblyFolder
if ghcompfolder not in sys.path:
    sys.path.append(ghcompfolder)

try:
    from Alpaca4d import alpaca4d as alpaca
except:
    msg = "Cannot import Alpaca4d. Is the Alpaca4d folder available in " + ghcompfolder + "?"
    ghenv.Component.AddRuntimeMessage(gh.Kernel.GH_RuntimeMessageLevel.Error, msg)


checkData = True

if not d:
    checkData = False
    msg = "Input parameter d failed to collect data"
    ghenv.Component.AddRuntimeMessage(gh.Kernel.GH_RuntimeMessageLevel.Warning, msg)

if not t:
    checkData = False
    msg = "Input parameter t failed to collect data"
    ghenv.Component.AddRuntimeMessage(gh.Kernel.GH_RuntimeMessageLevel.Warning, msg)

if not material:
    checkData = False
    msg = "Input parameter material failed to collect data"
    ghenv.Component.AddRuntimeMessage(gh.Kernel.GH_RuntimeMessageLevel.Warning, msg)



if checkData:
    circleCS = alpaca.CircleCS(d,t,material)
    Section = alpaca.ElasticSection(secName, circleCS.Area(), circleCS.Izz(), circleCS.Iyy(), circleCS.J(), circleCS.alphaY, circleCS.alphaZ, circleCS.material)
    Section.crv = circleCS.crv
    Section.sectionBrep = circleCS.sectionBrep
# ---------- end cs ----------
rs = RectangularSectionAlpaca4d(b=Slider(0.3, range=0..1), h=Slider(0.7, range=0..1), material=uem.uniAxialMaterial)  # -> out, Section
# ---------- rs: Python ----------
"""
Create a Rectangular Cross Section
-
    Args:
        secName:
        Area:
        Izz:
        Iyy:
        J:
        alphaY:
        alphaZ:
        material:
    Returns:
        Section:
"""
ghenv.Component.Name = "Rectangular Section (Alpaca4d)"
ghenv.Component.NickName = 'RS'
ghenv.Component.Message = "Rectangular Section (Alpaca4d)"

import sys
import Rhino.Geometry as rg
import Grasshopper as gh
import copy


## add alpaca install directory to system path

ghcompfolder = gh.Folders.DefaultAssemblyFolder
if ghcompfolder not in sys.path:
    sys.path.append(ghcompfolder)

try:
    from Alpaca4d import alpaca4d as alpaca
except:
    msg = "Cannot import Alpaca4d. Is the Alpaca4d folder available in " + ghcompfolder + "?"
    ghenv.Component.AddRuntimeMessage(gh.Kernel.GH_RuntimeMessageLevel.Error, msg)


checkData = True

if not b:
    checkData = False
    msg = "Input parameter b failed to collect data"
    ghenv.Component.AddRuntimeMessage(gh.Kernel.GH_RuntimeMessageLevel.Warning, msg)

if not h:
    checkData = False
    msg = "Input parameter h failed to collect data"
    ghenv.Component.AddRuntimeMessage(gh.Kernel.GH_RuntimeMessageLevel.Warning, msg)

if not material:
    checkData = False
    msg = "Input parameter material failed to collect data"
    ghenv.Component.AddRuntimeMessage(gh.Kernel.GH_RuntimeMessageLevel.Warning, msg)



if checkData:
    rectCS = alpaca.RectangularCS(b,h,material)
    Section = alpaca.ElasticSection(secName, rectCS.Area(), rectCS.Izz(), rectCS.Iyy(), rectCS.J(), rectCS.alphaY, rectCS.alphaZ, rectCS.material)
    Section.crv = rectCS.crv
    Section.sectionBrep = rectCS.sectionBrep
# ---------- end rs ----------
rs_2 = RectangularSectionAlpaca4d(b=Slider(0.7, range=0..1), h=Slider(0.3, range=0..1), material=uem.uniAxialMaterial)  # -> out, Section; same code as rs
rs_3 = RectangularSectionAlpaca4d(b=Slider(0.3, range=0..1), h=Slider(0.7, range=0..1), material=uem.uniAxialMaterial)  # -> out, Section; same code as rs

fbc = ForceBeamColumnAlpaca4d(Line=data_16, Section=rs_3.Section, Colour=ColourSwatch(SwatchColor=RGB(153, 231, 255)))  # -> out, Element; inputs Line: Curve, Colour: Color
# ---------- fbc: Python ----------
"""
Create a Force Beam Column
-
    Args:
        Line:
        Section:
        Colour:
        Orient:
    Returns:
        Element:
"""

ghenv.Component.Name = "Force Beam Column (Alpaca4d)"
ghenv.Component.NickName = 'FBC'
ghenv.Component.Message = "Force Beam Column (Alpaca4d)"


import sys
import Rhino.Geometry as rg
import Grasshopper as gh
import copy
from System.Drawing import Color

## add alpaca install directory to system path

ghcompfolder = gh.Folders.DefaultAssemblyFolder
if ghcompfolder not in sys.path:
    sys.path.append(ghcompfolder)

try:
    from Alpaca4d import alpaca4d as alpaca
except:
    msg = "Cannot import Alpaca4d. Is the Alpaca4d folder available in " + ghcompfolder + "?"
    ghenv.Component.AddRuntimeMessage(gh.Kernel.GH_RuntimeMessageLevel.Error, msg)


checkData = True

if not Line:
    checkData = False
    msg = "Input parameter Line failed to collect data"
    ghenv.Component.AddRuntimeMessage(gh.Kernel.GH_RuntimeMessageLevel.Warning, msg)


if not Section:
    checkData = False
    msg = "Input parameter Section failed to collect data"
    ghenv.Component.AddRuntimeMessage(gh.Kernel.GH_RuntimeMessageLevel.Warning, msg)

if not Colour:
    Colour = Color.Red

if not Orient:
    Orient = 0.0


if checkData:
    newCrossSection = copy.deepcopy(Section)
    Element = alpaca.ForceBeamColumn(Line, newCrossSection, Colour, Orient)
# ---------- end fbc ----------
fbc_2 = ForceBeamColumnAlpaca4d(Line=partition_2, Section=gs.Section, Colour=ColourSwatch(SwatchColor=RGB(195, 255, 0)))  # -> out, Element; inputs Line: Curve, Colour: Color; same code as fbc
fbc_3 = ForceBeamColumnAlpaca4d(Line=merge_3, Section=rs.Section, Colour=ColourSwatch(SwatchColor=RGB(255, 64, 150)))  # -> out, Element; inputs Line: Curve, Colour: Color; same code as fbc
fbc_4 = ForceBeamColumnAlpaca4d(Line=data_15, Section=rs_2.Section, Colour=ColourSwatch(SwatchColor=RGB(255, 223, 64)))  # -> out, Element; inputs Line: Curve, Colour: Color; same code as fbc
fbc_5 = ForceBeamColumnAlpaca4d(Line=partition, Section=cs.Section, Colour=ColourSwatch(SwatchColor=RGB(0, 106, 255)))  # -> out, Element; inputs Line: Curve, Colour: Color; same code as fbc

am = AssembleModelAlpaca4d(
    Element=flatten([fbc_4.Element, fbc_5.Element, fbc.Element, fbc_3.Element]),
    Support=flatten([support_2, support]),
    Load=flatten([pl.Load, pl_2.Load]),
    Constraint=flatten(rd.Constraint))  # -> out, AlpacaModel, Mass; inputs Element: list, Support: list, Load: list, Constraint: list
# ---------- am: Python ----------
"""
Create a FEA Model
-
    Args:
        Element:
        Support:
        Load:
        Constraint:
    Returns:
        AlpacaModel:
"""

ghenv.Component.Name = "Assemble Model (Alpaca4d)"
ghenv.Component.NickName = 'AM'
ghenv.Component.Message = "Assemble Model (Alpaca4d)"




import os
import sys
from Alpaca4d import alpaca4d as alpaca
import ghpythonlib.treehelpers as th
import Rhino.Geometry as rg
import Rhino.Collections as rc
import rhinoscriptsyntax as rs
from collections import defaultdict, OrderedDict
import copy
import time
import Grasshopper as gh

## add alpaca install directory to system path

ghcompfolder = gh.Folders.DefaultAssemblyFolder
if ghcompfolder not in sys.path:
    sys.path.append(ghcompfolder)

try:
    from Alpaca4d import alpaca4d as alpaca
except:
    msg = "Cannot import Alpaca4d. Is the Alpaca4d folder available in " + ghcompfolder + "?"
    ghenv.Component.AddRuntimeMessage(gh.Kernel.GH_RuntimeMessageLevel.Error, msg)


checkData = True

if not Element:
    checkData = False
    msg = "Input parameter Element failed to collect data"
    ghenv.Component.AddRuntimeMessage(gh.Kernel.GH_RuntimeMessageLevel.Warning, msg)

if not Support:
    checkData = False
    msg = "Input parameter Support failed to collect data"
    ghenv.Component.AddRuntimeMessage(gh.Kernel.GH_RuntimeMessageLevel.Warning, msg)


if checkData:
    
    FolderPath = rs.DocumentPath()
    os.chdir(FolderPath)
    
    # create the object model
    AlpacaModel = alpaca.Model()
    
    
    start = time.clock()
    #subdivide element per type
    
    for element in Element:
        if element.type == "Beam":
            AlpacaModel.beams.append(element)
        elif element.type == "Shell":
            AlpacaModel.shells.append(element)
        elif element.type == "Brick":
            AlpacaModel.bricks.append(element)
    
    end = time.clock() - start
    print("time to subdivide element {}".format(end))
    start = time.clock()
    
    # create a list of unique point
    # need to add the rigid constraint
    
    AlpacaModel.getuniquePoints(AlpacaModel.beams, AlpacaModel.shells, AlpacaModel.bricks, Constraint)
    
    
    end = time.clock() - start
    print("time to get uniquepoints {}".format(end))
    start = time.clock()
    
    
    #############
    # create node and assign to object
    #############
    
    if AlpacaModel.uniquePointsThreeNDF:
        AlpacaModel.py.append(alpaca.Model.write3ndf_tcl())
        for point in AlpacaModel.uniquePointsThreeNDF:
            node = alpaca.Node(point)
            node.ndf = 3
            node.setNodeTag(AlpacaModel)
            AlpacaModel.nodes.append( node )
        
            AlpacaModel.py.append(node.write_tcl())
    
    
    if AlpacaModel.uniquePointsSixNDF:
        AlpacaModel.py.append(alpaca.Model.write6ndf_tcl())
        for point in AlpacaModel.uniquePointsSixNDF:
            node = alpaca.Node(point)
            node.ndf = 6
            node.setNodeTag(AlpacaModel)
            AlpacaModel.nodes.append( node )
         
            AlpacaModel.py.append(node.write_tcl())
    
    
    
    end = time.clock() - start
    print("time to create node and assign tag {}".format(end))
    start = time.clock()
    
    
    #################
    # create supports
    #################
    
    for supportNode in Support:
        
        # if the list is empty, skip this operation
        if AlpacaModel.uniquePointsThreeNDF:
            closestPointInThreeNDF = rc.Point3dList.ClosestPointInList(AlpacaModel.uniquePointsThreeNDF, supportNode.Pos)
            if supportNode.Pos.DistanceTo(closestPointInThreeNDF) < 0.001:
                #print("I am in 3ndf")
                supportNode.ndf = 3
                AlpacaModel.threeNDFModel.append(supportNode)
                supportNode.setNodeTag(AlpacaModel)
        
        if AlpacaModel.uniquePointsSixNDF:
            closestPointInSixNDF = rc.Point3dList.ClosestPointInList(AlpacaModel.uniquePointsSixNDF, supportNode.Pos)
            if supportNode.Pos.DistanceTo(closestPointInSixNDF) < 0.001:
                supportNode.ndf = 6
                AlpacaModel.sixNDFModel.append(supportNode)
                supportNode.setNodeTag(AlpacaModel)
        
        
        AlpacaModel.supports.append(supportNode)
        AlpacaModel.py.append(supportNode.write_tcl())
    
    
    end = time.clock() - start
    print("time to create support and assign tag {}".format(end))
    start = time.clock()
    
    
    ####################
    # create constraints
    ####################
    
    
    for constraint in Constraint:
        constraint.setNodeTag(AlpacaModel)
        AlpacaModel.constraints.append(constraint)
    
    ####################
    # create equalDOF when the model has 3df and 6df together
    ####################
    
    
    end = time.clock() - start
    print("time to create constraint and assign tag {}".format(end))
    start = time.clock()
    
    
    Id = []
    IdB = []
    
    def SearchCallback(sender, e):
        Id.Add(e.Id)
        IdB.Add(e.IdB)
    
    
    
    lenThreeNDF = len(AlpacaModel.uniquePointsThreeNDF)
    lenSixNDF = len(AlpacaModel.uniquePointsSixNDF)
    
    
    if not(lenThreeNDF == 0 or lenSixNDF == 0):
        print("brick and beam together")
        rg.RTree.SearchOverlaps(AlpacaModel.RTreeCloudPointThreeNDF, AlpacaModel.RTreeCloudPointSixNDF, 0.001, SearchCallback)
        
        for i,j in zip(Id, IdB):
            print(i,j)
            node_i = AlpacaModel.uniquePointsThreeNDF[i]
            node_j = AlpacaModel.uniquePointsSixNDF[j]
            
            #index_i = AlpacaModel.cloudPoint.ClosestPoint(node_i) + 1
            #index_j = AlpacaModel.cloudPoint.ClosestPoint(node_j) + 1
            
            equalConstraint = alpaca.EqualDOF(node_i, node_j, True, True, True, False, False, False)
            equalConstraint.masterNodeTag = AlpacaModel.cloudPointThreeNDF.ClosestPoint(node_i) + 1
            equalConstraint.slaveNodesTag = AlpacaModel.cloudPointSixNDF.ClosestPoint(node_j) + 1 + len(AlpacaModel.uniquePointsThreeNDF)
            AlpacaModel.py.append(equalConstraint.write_tcl())
    
    
    
    end = time.clock() - start
    print("time to find common points between 3ndf and 6ndf {}".format(end))
    start = time.clock()
    
    
    # write py file
    
    
    # assign tag and node Index to element and shell
    for index, element in enumerate(Element,1):
        element.setTopologyRTree(AlpacaModel)
        element.eleTag = index
        element.setTags()
    
    
    
    end = time.clock() - start
    print("time to assign tags for the elements {}".format(end))
    start = time.clock()
    
    
    
    Mass = 0
    IsGravity = False
    
    for item in Load:
        if item.type == "Gravity Load":
            IsGravity = True
            GravityLoad = item
        if item.type == "PointLoad":
            AlpacaModel.loads.append(item)
    
    
    for item in Element:
        if item.type == "Beam":
            length = item.Crv.GetLength()
            Mass += (item.massDens * length)
            if IsGravity:
                gravityPointLoad = alpaca.PointLoad(item.Crv.PointAtStart, rg.Vector3d(0,0, -(item.massDens * length / 2)) * GravityLoad.GravityFactor, rg.Vector3d(0,0,0), GravityLoad.TimeSeries)
                #print( -(item.massDens * length / 2))
                AlpacaModel.loads.append(gravityPointLoad)
        if item.type == "Shell":
            meshArea = rg.AreaMassProperties.Compute(item.Mesh).Area
            areaDensity = item.CrossSection.height * item.CrossSection.material.rho
            Mass += areaDensity * meshArea
            if IsGravity:
                for vertex in item.Mesh.Vertices.ToPoint3dArray():
                    gravityPointLoad = alpaca.PointLoad(vertex, rg.Vector3d(0,0, -(areaDensity * meshArea/ len(item.Mesh.Vertices))) * GravityLoad.GravityFactor, rg.Vector3d(0,0,0), GravityLoad.TimeSeries)
                    AlpacaModel.loads.append(gravityPointLoad)
        if item.type == "Brick":
            #print(type(item.Mesh))
            meshVolume = rg.VolumeMassProperties.Compute(item.Mesh).Volume
            density = item.material.rho 
            Mass += density * meshVolume
            if IsGravity:
                for vertex in item.Mesh.Vertices.ToPoint3dArray():
                    gravityPointLoad = alpaca.PointLoad(vertex, rg.Vector3d(0,0, -(density * meshVolume / len(item.Mesh.Vertices))) * GravityLoad.GravityFactor, rg.Vector3d(0,0,0), GravityLoad.TimeSeries)
                    #print(len(item.Mesh.Vertices))
                    #print(density)
                    # volume can be zero if mesh faces are not properly rotated
                    #print(meshVolume)
                    #print(-(density * meshVolume / len(item.Mesh.Vertices)))
                    AlpacaModel.loads.append(gravityPointLoad)
    
    #print(AlpacaModel.loads)
    ## load
    
    
    for item in AlpacaModel.loads:
        item.setNodeTag(AlpacaModel)
    
    #print(AlpacaModel.loads)
    
    for item in AlpacaModel.beams:
        AlpacaModel.py.append(item.write_tcl())
    
    for item in AlpacaModel.shells:
        AlpacaModel.py.append(item.write_tcl())
    
    for item in AlpacaModel.bricks:
        AlpacaModel.py.append(item.write_tcl())
    
    
    for item in Constraint:
        AlpacaModel.py.append(item.write_tcl())
    
    
    timeSeriesDict = alpaca.TimeSeries.getTimeSeries(AlpacaModel.loads)[1]
    AlpacaModel.py.append(alpaca.PointLoad.write_tcl(timeSeriesDict,AlpacaModel))
# ---------- end am ----------
vm = ViewModelAlpaca4d(AlpacaModel=am.AlpacaModel, type=Toggle(True))  # -> a; inputs type: Boolean, nodeTag: Boolean, eleTag: Boolean, localAxis: Boolean, support: Boolean, load: Boolean
# ---------- vm: Python ----------
"""View structural Model
    Inputs:
        AlpacaModel: Output of Assemble Model.
        type: Style of visualize Model 
Default: Visualize the stick Model
True: Visualize the extrude Model
        nodeTag: 
True: Visualize tag nodes
        eleTag: 
True: Visualize tag elements 
        LocalAxes:
True: Visualize local Axis of elements 
        Support: 
True: Visualize support type
        Load: 
True: Visualize load
"""


from ghpythonlib.componentbase import executingcomponent as component
import Grasshopper, GhPython
import System
import ghpythonlib.components as ghcomp

import Rhino as rc
import rhinoscriptsyntax as rs
import sys
import Rhino.Geometry as rg
import Grasshopper as gh
import copy

ghenv.Component.Name = "View Model (Alpaca4d)"
ghenv.Component.NickName = 'VM'
ghenv.Component.Message = "View Model (Alpaca4d)"

ghcompfolder = gh.Folders.DefaultAssemblyFolder
if ghcompfolder not in sys.path:
    sys.path.append(ghcompfolder)
try:
    from Alpaca4d import alpaca4dView as alpacaView
except:
    msg = "Cannot import Alpaca4d. Is the Alpaca4d folder available in " + ghcompfolder + "?"
    ghenv.Component.AddRuntimeMessage(gh.Kernel.GH_RuntimeMessageLevel.Error, msg)

checkData = True

class MyComponent(component):
    
    def RunScript(self, AlpacaModel, type, nodeTag, eleTag, localAxis, support, load):
        
        
        self.ModelBeam = []
        self.ModelShell = []
        self.ModelBrick = []
        self.Nodes = []
        self.TagEle = []
        self.localAxis = []
        self.solidSupport = []
        self.viewLoad = []
        
        if not AlpacaModel:
            checkData = False
            msg = "Input parameter AlpacaModel failed to collect data"
            ghenv.Component.AddRuntimeMessage(gh.Kernel.GH_RuntimeMessageLevel.Warning, msg)
        else:
            self.type = type
            
            ## add alpaca install directory to system path
            
            self.ModelBeam = alpacaView.ViewBeam( AlpacaModel, type)
            self.ModelShell = alpacaView.ViewShell( AlpacaModel, type )
            self.ModelBrick = alpacaView.ViewBrick( AlpacaModel)
            #NODE TAG VIEW
            if nodeTag is True:
                self.Nodes = [ [inode.nodeTag, inode.Pos] for inode in AlpacaModel.nodes]
            else:
                self.Nodes = []
            #ELE TAG VIEW
            if eleTag is True:
                TagBeam = [ [item.eleTag, item.getPerpFrame().Origin] for item in AlpacaModel.beams]
                TagShell = [ [item.eleTag, rg.AreaMassProperties.Compute( item.Mesh, False, True, False, False ).Centroid] for item in AlpacaModel.shells]
                TagBrick = [ [item.eleTag, rg.AreaMassProperties.Compute( item.Mesh, False, True, False, False ).Centroid] for item in AlpacaModel.bricks]
                self.TagEle = TagBeam + TagShell + TagBrick
            else:
                self.TagEle = []
            #LOCAL AXIS
            if localAxis is True:
                self.localAxis = [ item.getPerpFrame() for item in AlpacaModel.beams]
            else:
                self.localAxis = []
            #SUPPORT
            if support is True:
                scale = 0.5
                self.solidSupport = [ alpacaView.Support( iSupport, scale ) for iSupport in AlpacaModel.supports ]
            else:
                self.solidSupport = []
            # LOAD
            if load is True:
                self.viewLoad =[[item.Pos, item.Force, item.Moment] for item in AlpacaModel.loads]
            else:
                self.viewLoad = []
            self.forceBounds = ghcomp.Bounds([ item[1] for item in self.viewLoad])
            self.momentBounds = ghcomp.Bounds([ item[2] for item in self.viewLoad])
            
            a = [ i[0] for i in self.ModelBeam ]
            return a 
    def DrawViewportWires(self,arg):
        # Beam
        for iBeam in self.ModelBeam:
            color = iBeam[1]
            colorMaterial = rc.Display.DisplayMaterial(color, 0.3)
            if self.type is True:
                colorWirframe = System.Drawing.Color.Gray
                #System.Drawing.Color.LightGray
                arg.Display.DrawBrepShaded(iBeam[0], colorMaterial)
                arg.Display.DrawBrepWires(iBeam[0], colorWirframe)
            else :
                thickness =2
                arg.Display.DrawCurve(iBeam[0], color, thickness)
        # Mesh
        for iShell in self.ModelShell:
            color = iShell[1]
            #color = System.Drawing.Color.Blue
            colorMaterial = rc.Display.DisplayMaterial(color,color,color,color,1,0.30)
            colorMaterial.IsTwoSided = False
            arg.Display.DrawMeshShaded(iShell[0], colorMaterial)
            colorWirframe = System.Drawing.Color.Black
            arg.Display.DrawMeshWires(iShell[0], colorWirframe)
        #Brick 
        for iBrick in self.ModelBrick:
            color = iBrick[1]
            #color = System.Drawing.Color.Blue
            colorMaterial = rc.Display.DisplayMaterial(color,color,color,color,1,0.30)
            colorMaterial.IsTwoSided = False
            arg.Display.DrawMeshShaded(iBrick[0], colorMaterial)
            colorWirframe = System.Drawing.Color.Black
            arg.Display.DrawMeshWires(iBrick[0], colorWirframe)
            
        # node Tag view
        for inode in self.Nodes:
            arg.Display.Draw2dText( str(inode[0]), System.Drawing.Color.DarkSlateBlue, inode[1], True, 50)
        # ele Tag view
        for iEle in self.TagEle:
            arg.Display.Draw2dText( str(iEle[0]), System.Drawing.Color.BlanchedAlmond, iEle[1], True, 50)
        # local Axis
        for iLocalAxis in self.localAxis:
            arg.Display.DrawArrow( rg.Line(iLocalAxis.Origin, iLocalAxis.XAxis), System.Drawing.Color.Red)
            arg.Display.DrawArrow( rg.Line(iLocalAxis.Origin, iLocalAxis.YAxis), System.Drawing.Color.Green)
            arg.Display.DrawArrow( rg.Line(iLocalAxis.Origin, iLocalAxis.ZAxis), System.Drawing.Color.Blue)
            
        color = System.Drawing.Color.Azure
        colorWirframe = System.Drawing.Color.Black
        colorMaterial = rc.Display.DisplayMaterial(color, 0.0)
        for iSupport in self.solidSupport :
            arg.Display.DrawBrepShaded( iSupport, colorMaterial)
            arg.Display.DrawBrepWires( iSupport, colorWirframe)
            
        for iLoad in self.viewLoad:
            arg.Display.DrawArrow( rg.Line(iLoad[0], iLoad[1]/self.forceBounds[1]) ,  System.Drawing.Color.DarkRed)
            arg.Display.DrawArrow( rg.Line(iLoad[0], iLoad[2]/self.momentBounds[1]) ,  System.Drawing.Color.DarkBlue)
# ---------- end vm ----------
ra = RunAnalysisAlpaca4d(AlpacaModel=am.AlpacaModel, Settings=as)  # -> log, AlpacaSolvedModel
# ---------- ra: Python ----------
"""
Run an OpenSees Analysis
-
    Args:
        AlpacaModel:
        Settings:
    Returns:
        AlpacaSolvedModel:
"""



import Rhino.RhinoDoc
import Grasshopper as gh
import copy
import rhinoscriptsyntax as rs
import os
import time
import sys



ghenv.Component.Name = "Run Analysis (Alpaca4d)"
ghenv.Component.NickName = 'RA'
ghenv.Component.Message = "Run Analysis (Alpaca4d)"

ghcompfolder = gh.Folders.DefaultAssemblyFolder
if ghcompfolder not in sys.path:
    sys.path.append(ghcompfolder)

try:
    from Alpaca4d import alpaca4d as alpaca
except:
    msg = "Cannot import Alpaca4d. Is the Alpaca4d folder available in " + ghcompfolder + "?"
    ghenv.Component.AddRuntimeMessage(gh.Kernel.GH_RuntimeMessageLevel.Error, msg)


checkData = True



if not AlpacaModel:
    checkData = False
    msg = "Input parameter AlpacaModel failed to collect data"
    ghenv.Component.AddRuntimeMessage(gh.Kernel.GH_RuntimeMessageLevel.Warning, msg)


if not Settings:
    checkData = False
    msg = "Input parameter Settings failed to collect data"
    ghenv.Component.AddRuntimeMessage(gh.Kernel.GH_RuntimeMessageLevel.Warning, msg)


if checkData:
    FolderPath = rs.DocumentPath()
    os.chdir(FolderPath)
    
    outputFileName = 'openSeesModel'
    recorderFileName = 'recorder.mpco'
    
    for dirpath, dirnames, filenames in os.walk(FolderPath):
        for filename in filenames:
            if filename == outputFileName:
                file = os.path.join(dirpath,outputFileName)
                os.remove(file)
            elif filename == recorderFileName:
                file = os.path.join(dirpath,recorderFileName)
                os.remove(file)
    
    
    # create a copy
    
    AnalysisModel = copy.copy(AlpacaModel)
    AnalysisModel.py = list(AnalysisModel.py)
    
    # generate Recorder and assign name
    AnalysisModel.recorderName = "recorder" + ".mpco"
    
    AnalysisModel.py.append(alpaca.TCLRecorder.mpco(AnalysisModel.recorderName, True,True,True,True,False,False,True,True,True,True))
    
    
    AnalysisModel.analysis = Settings
    AnalysisModel.py.append(Settings.write_tcl())
    AnalysisModel.py.append("wipe")
    
    
    #textFile = AnalysisModel.py
    
    time_start = time.clock()
    
    AnalysisModel.writeFile(outputFileName)
    
    time_elapsed = (time.clock() - time_start)
    print("Writing Time {}".format(time_elapsed))
    
    
    
    time_start = time.clock()
    
    executable = os.path.join(ghcompfolder,'Alpaca4d\OpenSees-Solvers\opensees.bat')
    a, log = AnalysisModel.runOpensees(executable)
    
    
    time_elapsed = (time.clock() - time_start)
    print("Analyses Time {}".format(time_elapsed))
    
    AlpacaSolvedModel = copy.copy(AnalysisModel)
    AlpacaSolvedModel.isAnalysed = True
# ---------- end ra ----------
panel_3 = Panel(ra.log)
dm = DeformedModelAlpaca4d(
    AlpacaSolvedModel=ra.AlpacaSolvedModel,
    step=Slider(0, range=0..10),
    scale=num,
    extrudeModel=Toggle(True),
    typeColor=Slider(3, range=-4..10),
    listColor=gradientlibrary)  # -> DefModel, bounds; inputs step: Int32, extrudeModel: Boolean, typeColor: Int32, listColor: list of Color
# ---------- dm: Python ----------
"""View Deformed model
    Args:
        AlpacaSolvedModel: Output of Analyses solver
        step:
        scale: Multiplication factor for displacement
        extrudeModel:  
True : view extruded model
else : view stick model
        typeColor:  View relative color of the traslation
<=0 : view traslation X 
1 : view traslation Y
2 : view traslation Z
>= 3 : view resulting displacement.
        listColor : one list of color 

    Output:
       DefModel: view deformed model
       bounds: max end min of displacement of the structure 
"""

ghenv.Component.Name = "Deformed Model (Alpaca4d)"
ghenv.Component.NickName = 'DM'
ghenv.Component.Message = "Deformed Model (Alpaca4d)"

from ghpythonlib.componentbase import executingcomponent as component
import System
import rhinoscriptsyntax as rs

import sys
import os
import clr
import clrtype
import Rhino.Geometry as rg
import Rhino as rc
import math as mt
import Grasshopper as gh
import ghpythonlib.treehelpers as th
from ghpythonlib.components import ConstructDomain

ghcompfolder = gh.Folders.DefaultAssemblyFolder
if ghcompfolder not in sys.path:
    sys.path.append(ghcompfolder)
try:
    from Alpaca4d import alpaca4dView as alpacaView
except:
    msg = "Cannot import Alpaca4d. Is the Alpaca4d folder available in " + ghcompfolder + "?"
    ghenv.Component.AddRuntimeMessage(gh.Kernel.GH_RuntimeMessageLevel.Error, msg)
    
FolderPath = rs.DocumentPath()
os.chdir(FolderPath)

ghcompfolder = gh.Folders.DefaultAssemblyFolder
my_module_name = "Alpaca_StepReader" # replace this with something unique that doesn't collide with a real module!
my_module = sys.modules.setdefault(my_module_name, type(sys)(my_module_name))

hdfFilePath = os.path.join(ghcompfolder, "Alpaca4d\HDF5CSharp.dll")
clr.AddReferenceToFileAndPath(hdfFilePath)


from HDF5CSharp import Hdf5

class MyComponent(component):
    
    def RunScript(self, AlpacaSolvedModel, step = None, scale = None , extrudeModel = None, typeColor = None, listColor = [] ):
        import sys
        
        self.extrudeModel = extrudeModel
        
        self.defModel1 = []
        self.defModel2 = []
        self.defModel3 = []
        
        self.beamColor = []
        

        if step == None:
            step = 0
        if scale == None:
            scale = 1
        if extrudeModel == None:
            extrudeModel = False
        if typeColor == None:
            typeColor = 3
        
        if not listColor: listColor = [ System.Drawing.Color.DarkViolet, 
                                        System.Drawing.Color.BlueViolet, 
                                        System.Drawing.Color.RoyalBlue, 
                                        System.Drawing.Color.CornflowerBlue,
                                        System.Drawing.Color.LightSkyBlue, 
                                        System.Drawing.Color.LightBlue,
                                        System.Drawing.Color.CadetBlue,
                                        System.Drawing.Color.LightGreen,
                                        System.Drawing.Color.GreenYellow,
                                        System.Drawing.Color.Yellow,
                                        System.Drawing.Color.Orange,
                                        System.Drawing.Color.Red,
                                        System.Drawing.Color.DarkRed]
        
        
        ghcompfolder = gh.Folders.DefaultAssemblyFolder
        if ghcompfolder not in sys.path:
            sys.path.append(ghcompfolder)
    
        try:
            Steps = my_module.Steps
        except AttributeError:
            type_2d = type(System.Array.CreateInstance(float, 1, 1))
                
            class Steps(object):
                __metaclass__ = clrtype.ClrClass
                _clrfields = {"STEP_{}".format(i): type_2d for i in range(1000)} # it will work for model with less than 1000 steps
                
            my_module.Steps = Steps
            
        checkData = True
        
        if not AlpacaSolvedModel:
            checkData = False
            msg = "Input parameter AlpacaSolvedModel failed to collect data"
            ghenv.Component.AddRuntimeMessage(gh.Kernel.GH_RuntimeMessageLevel.Warning, msg)
        else:
            try:
                fileId = Hdf5.OpenFile(AlpacaSolvedModel.recorderName, True)
                numberOfPoints = len(AlpacaSolvedModel.uniquePoints) #
                        
                        
                displacementResult = Hdf5.ReadObject[Steps](fileId, "/MODEL_STAGE[1]/RESULTS/ON_NODES/DISPLACEMENT/DATA")
                displacement = []
                rotation = []
                dispNodeList = []
                for i in range(numberOfPoints):
                    tag = i + 1
                    vx = getattr(displacementResult, 'STEP_{}'.format(step))[i,0]
                    vy = getattr(displacementResult, 'STEP_{}'.format(step))[i,1]
                    vz = getattr(displacementResult, 'STEP_{}'.format(step))[i,2]
                    trasl = rg.Vector3d(vx,vy,vz)
                    displacement.append(trasl)
                    dispNodeList.append( [tag, trasl] )
                    
                Hdf5.CloseFile(fileId)
                print("I have closed the file")
            
                dispNodeDict = dict( dispNodeList )
                #---------------------------------------------------#
                defEleVector1 = alpacaView.BeamVectorDef(AlpacaSolvedModel,dispNodeDict) #beam
                defEleVector2 = alpacaView.ShellVectorDef(AlpacaSolvedModel,dispNodeDict) #shell
                defEleVector3 = alpacaView.BrickVectorDef(AlpacaSolvedModel,dispNodeDict) #shell
                bound = alpacaView.boundsDef(displacement, typeColor)
                if self.extrudeModel == None or self.extrudeModel == False:
                    #BEAM
                    defModel1 = alpacaView.BeamDef(AlpacaSolvedModel, dispNodeDict,scale)
                    self.defModel1, self.beamColor = alpacaView.ColorBeamDef( defModel1, defEleVector1, bound, listColor, typeColor)
                    #SHELL
                    defModel2 = alpacaView.ShellDef(AlpacaSolvedModel,dispNodeDict,scale)
                    #BRICK
                    defModel3 = alpacaView.BrickDef(AlpacaSolvedModel,dispNodeDict,scale)
                else:
                    #BEAM
                    defModel1 = alpacaView.BeamDefExtrude(AlpacaSolvedModel, dispNodeDict,scale)
                    self.defModel1 = alpacaView.ColorBeamDefExtrude( defModel1, defEleVector1, bound, listColor, typeColor)
                    #SHELL
                    defModel2 = alpacaView.ShellDefExtrude(AlpacaSolvedModel,dispNodeDict,scale)
                    #BRICK
                    defModel3 = alpacaView.BrickDef(AlpacaSolvedModel,dispNodeDict,scale)
                    
                #SHELL COLOR
                self.defModel2 = alpacaView.ColorShellDef( defModel2, defEleVector2 , bound, listColor, typeColor, extrudeModel )
                #BRICK COLOR
                self.defModel3 = alpacaView.ColorBrickDef( defModel3, defEleVector3 , bound, listColor, typeColor)
                DefModel = th.list_to_tree(self.defModel1 + defModel2 + defModel3)
                bounds = ConstructDomain(bound[0], bound[1])
                return (DefModel, bounds)
            except:
                Hdf5.CloseFile(fileId)
                print("I have closed the file due to exception")
            # return outputs if you have them; here I try it for you:
        
        
    def DrawViewportWires(self,arg):
        for iMesh in self.defModel2 :
            colorWirframe = System.Drawing.Color.Black
            arg.Display.DrawMeshWires(iMesh, colorWirframe)
            
        for iMesh in self.defModel3 :
            colorWirframe = System.Drawing.Color.Black
            arg.Display.DrawMeshWires(iMesh, colorWirframe)
        if self.extrudeModel is None or self.extrudeModel is False:
            thickness =2
            for iBeam, iColor in zip(self.defModel1, self.beamColor) :
                for jBeam, jColor in zip(iBeam, iColor):
                    arg.Display.DrawCurve(jBeam, jColor, thickness)
        else:
            for iBeam in self.defModel1 :
                colorWirframe = System.Drawing.Color.Black
                arg.Display.DrawMeshWires(iBeam, colorWirframe)
# ---------- end dm ----------
bfd = BeamForcesDiagramAlpaca4d(AlpacaSolvedModel=ra.AlpacaSolvedModel, cdsType=number_slider_2, viewValue=toggle_3)  # -> ForcesDiagram; inputs step: Int32, cdsType: Int32; disabled
# ---------- bfd: Python ----------
"""
View Diagram of internal beam forces

    Args:
        AlpacaModel:
        cdsType: 
    0: to view N (forces in direction 3)
    1: to view M2 (Moments around axis 2)
    2: to view T1 (forces in direction 1)
    3: to view M1 (Moments around axis 1)
    4: to view T2 (forces in direction 2)
    5: to view Mt (Moments around axis 3)
        step:
        scale: scale factor
        viewValue: to view the force value
    Returns:
        ForcesDiagram: Diagram of internal beam forces
"""


ghenv.Component.Name = "BeamForcesDiagram (Alpaca4d)"
ghenv.Component.NickName = 'BFD'
ghenv.Component.Message = "Beam Forces Diagram (Alpaca4d)"

from ghpythonlib.componentbase import executingcomponent as component
import Grasshopper, GhPython
import rhinoscriptsyntax as rs
import sys
import os
import System
import clr
import Rhino.Geometry as rg
import Grasshopper as gh
import copy
import Rhino


from Alpaca4d import alpaca4d as alpaca
from Alpaca4d import alpaca4dView as alpacaView
FolderPath = rs.DocumentPath()
os.chdir(FolderPath)

ghcompfolder = gh.Folders.DefaultAssemblyFolder
if ghcompfolder not in sys.path:
    sys.path.append(ghcompfolder)

# import costum modules to read the hdf5 file
my_module_name = "Alpaca_StepReader"
my_module = sys.modules.setdefault(my_module_name, type(sys)(my_module_name))

hdfFilePath = os.path.join(ghcompfolder, "Alpaca4d\HDF5CSharp.dll")
clr.AddReferenceToFileAndPath(hdfFilePath)

from HDF5CSharp import Hdf5

try:
    Steps = my_module.Steps
except AttributeError:
    type_2d = type(System.Array.CreateInstance(float, 1, 1))

    class Steps(object):
        __metaclass__ = clrtype.ClrClass
        _clrfields = {"STEP_{}".format(i): type_2d for i in range(1000)} # it will work for model with less than 1000 steps
    
    my_module.Steps = Steps

checkData = True

class MyComponent(component):
    
    def RunScript(self, AlpacaSolvedModel, step, cdsType, scale, viewValue):
        
        self.viewValue = viewValue
        
        
        self.Pos = []
        self.Valor = []
        self.ForcesDiagram = []
        
        
        if not AlpacaSolvedModel:
            checkData = False
            msg = "Input parameter AlpacaSolvedModel failed to collect data"
            ghenv.Component.AddRuntimeMessage(gh.Kernel.GH_RuntimeMessageLevel.Warning, msg)
        else:
            try:
                fileId = Hdf5.OpenFile(AlpacaSolvedModel.recorderName, True)
                
                stressResult = Hdf5.ReadObject[Steps](fileId, "/MODEL_STAGE[1]/RESULTS/ON_ELEMENTS/section.force/74-ForceBeamColumn3d[1000:1:0]/DATA")
                #stressResult = Hdf5.ReadObject[Steps](fileId, "/MODEL_STAGE[1]/RESULTS/ON_ELEMENTS/stresses/167-UnknownMovableObject[103:0:0]/DATA")
                if cdsType <= 0:
                    versorType, startRange, colorPos, colorNeg = 1, 0, System.Drawing.Color.SteelBlue, System.Drawing.Color.LightSalmon
                elif cdsType == 1:
                    versorType, startRange, colorPos, colorNeg = 1, 1, System.Drawing.Color.Aqua, System.Drawing.Color.IndianRed
                elif cdsType== 2:
                    versorType, startRange, colorPos, colorNeg = 1, 2, System.Drawing.Color.LightSalmon, System.Drawing.Color.LightSalmon
                elif cdsType == 3:
                    versorType, startRange, colorPos, colorNeg = 2, 3, System.Drawing.Color.SteelBlue, System.Drawing.Color.Yellow
                elif cdsType == 4:
                    versorType, startRange, colorPos, colorNeg = 2, 4, System.Drawing.Color.LawnGreen, System.Drawing.Color.LawnGreen
                else:
                    versorType, startRange, colorPos, colorNeg = 2, 5, System.Drawing.Color.BlueViolet, System.Drawing.Color.BlueViolet
                
                if scale is None : scale = 0.0025
                if step is None :  step = (int(AlpacaSolvedModel.analysis.NumberOfSteps) - 1) if step is None else step
                
                CDSView = []
                CDSPoint = []
                CDSValor = []
            
                for i,item in enumerate(AlpacaSolvedModel.beams):
                    ni = 5 # potrebbe cambiare per ogni trave
                    #Versore
                    e = item.getPerpFrame()[versorType]*-1
                    print(e)
                    valor = [ getattr(stressResult, 'STEP_{}'.format(step))[i,j] for j in range(startRange,ni*6, 6)]
                    print(valor)
                    cdsVector = [ rg.Vector3d.Multiply(e, ivalor*scale) for ivalor in valor ]
                    #----------------------------------------------------------------#
                    cdsView, cdsPoint = alpacaView.cdsMesh( item, cdsVector, colorPos, colorNeg)
                    CDSView.append(cdsView)
                    CDSPoint.append(cdsPoint)
                    CDSValor.append(valor)
                    
                Hdf5.CloseFile(fileId)
                
                self.Pos = CDSPoint
                self.Valor = CDSValor
                self.ForcesDiagram = CDSView
                return self.ForcesDiagram
            except:
                Hdf5.CloseFile(fileId)
    
        
    def DrawViewportWires(self,arg):
        # node Tag view
        for iPos, ivalor, iMesh in zip(self.Pos, self.Valor, self.ForcesDiagram) :
            colorWirframe = System.Drawing.Color.Black
            arg.Display.DrawMeshWires(iMesh, colorWirframe)
            if self.viewValue is True:
                for jpos, jvalor in zip(iPos, ivalor):
                    t = 25
                    txt = str( round( jvalor, 2))
                    arg.Display.Draw2dText( txt, System.Drawing.Color.Black, jpos, True, t)
# ---------- end bfd ----------
abs_3 = Absolute(Value=dm.bounds)
dedomain = DeconstructDomain(Domain=abs_3)  # -> Start, End
max = Maximum(A=dedomain.Start, B=dedomain.End)  # disabled
subtraction = Subtraction(A=max, B=division_6)  # disabled
abs_4 = Absolute(Value=subtraction)  # disabled

# ----
# Armature trasversali
# T-Rex plugin
debrep = DeconstructBrep(Brep=vm)  # -> Faces, Edges, Vertices; disabled
item_7 = ListItem(List=debrep.Faces, Index=0, Wrap=True)  # -> Item, Item1; disabled
area_4 = Area(Geometry=item_7.Item1)  # -> Area, Centroid; disabled
area_5 = Area(Geometry=item_7.Item)  # -> Area, Centroid; disabled
ln_3 = Line(StartPoint=area_5.Centroid, EndPoint=area_4.Centroid)  # disabled
unit_2 = UnitVector(Vector=ln_3)  # disabled
abs_5 = Absolute(Value=unit_2)  # disabled
pdecon_2 = Deconstruct(Point=abs_5)  # -> XComponent, YComponent, ZComponent; disabled
panel_4 = Panel("1")  # disabled
panel_5 = Panel("1")  # disabled
equals_2 = Equality(FirstNumber=pdecon_2.XComponent, SecondNumber=panel_4)  # -> Equality, Inequality; disabled
equals_3 = Equality(FirstNumber=pdecon_2.YComponent, SecondNumber=panel_5)  # -> Equality, Inequality; disabled
or = GateOr(A=equals_2.Equality, B=equals_3.Equality)  # disabled
dispatch_2 = Dispatch(List=item_7.Item, DispatchPattern=or)  # -> ListA, ListB; disabled
dispatch_3 = Dispatch(List=ln_3, DispatchPattern=or)  # -> ListA, ListB; disabled
data_21 = Data(dispatch_3.ListB)  # disabled
data_22 = Data(dispatch_2.ListA)  # disabled
trim = TrimTree(Tree=data_22, Depth=1)  # disabled
data_23 = Data(dispatch_3.ListA)  # disabled
rec = Rectangle(trim)  # disabled
trim_2 = TrimTree(Tree=data_23, Depth=1)  # disabled
panel_6 = Panel("-0.5")  # disabled
ext = ExtendCurve(Curve=trim_2, Type=0, Start=panel_6, End=panel_6)  # disabled
abs_6 = Absolute(Value=panel_6)  # disabled
end_7 = EndPoints(Curve=ext)  # -> Start, End; disabled
unit_3 = UnitVector(Vector=ext)  # disabled
ln_4 = Line(StartPoint=end_7.Start, EndPoint=end_7.End)  # disabled
multiplication_6 = Multiplication(A=unit_3, B=abs_6)  # disabled
move_3 = Move(Geometry=rec, Motion=multiplication_6)  # -> Geometry, Transform; disabled
data_24 = Data(dispatch_2.ListB)  # disabled
trim_3 = TrimTree(Tree=data_24, Depth=1)  # disabled
crv = Curve(trim_3)  # disabled
panel_7 = Panel("-0.03")  # disabled
panel_8 = Panel("B450C")  # disabled
panel_9 = Panel("78")  # disabled
offset = OffsetCurve(Curve=crv, Distance=panel_7, Plane=PlaneXY(0, 0, 0), Corners=1)  # disabled
material = Material(Name=panel_8, Grade="Grade", Density=panel_9)  # disabled
panel_10 = Panel("-0.1")  # disabled
panel_11 = Panel("0.03")  # disabled
panel_12 = Panel("0.01")  # disabled
Z_2 = UnitZ(Factor=panel_10)  # disabled
panel_13 = Panel("0.05")  # disabled
rebar_properties = RebarProperties(Diameter=panel_12, Material=material)  # disabled
cover_dimensions = CoverDimensions(Left=panel_11, Right=panel_11, Top=panel_11, Bottom=panel_11)  # disabled
bending_roller = BendingRoller(Diameter=panel_13, Tolerance=0.0001, AngleTolerance=0.0175)  # disabled
move_4 = Move(Geometry=offset, Motion=Z_2)  # -> Geometry, Transform; disabled
number_slider_5 = Slider(0.14, range=0..1)  # disabled
panel_14 = Panel("1")  # disabled
curve_to_rebar_shape = CurveToRebarShape(Curve=move_4.Geometry, Properties=rebar_properties)  # -> RebarShape, Mesh; disabled
rectangle_to_stirrup_shape = RectangleToStirrupShape(
    Rectangle=move_3.Geometry,
    Properties=rebar_properties,
    BendingRoller=bending_roller,
    HooksType=panel_14,
    HookLength=number_slider_5,
    CoverDimensions=cover_dimensions)  # -> RebarShape, Mesh; disabled
number_slider_6 = Slider(5.5, range=0..10)  # disabled
number_slider_7 = Slider(3.8, range=0..10)  # disabled
vec_2 = VectorXYZ(XComponent=0, YComponent=number_slider_6, ZComponent=0)  # -> Vector, Length; disabled
number_slider_8 = Slider(3, range=0..10)  # disabled
Z_3 = UnitZ(Factor=number_slider_7)  # disabled
number_slider_9 = Slider(3, range=0..10)  # disabled
panel_15 = Panel("0.3")  # disabled
panel_16 = Panel("0.3")  # disabled
neg_5 = Negative(Value=Z_3)  # disabled
panel_17 = Panel("1")  # disabled
neg_6 = Negative(Value=vec_2.Vector)  # disabled
panel_18 = Panel("1")  # disabled
vector_length_spacing = VectorLengthSpacing(
    Id=panel_17,
    RebarShape=curve_to_rebar_shape.RebarShape,
    Vector=neg_5,
    SpacingLength=panel_15,
    Type=number_slider_8,
    Tolerance=0.0001)  # -> RebarGroup, Mesh, Curve; disabled
vector_length_spacing_2 = VectorLengthSpacing(
    Id=panel_18,
    RebarShape=rectangle_to_stirrup_shape.RebarShape,
    Vector=ln_4,
    SpacingLength=panel_16,
    Type=number_slider_9,
    Tolerance=0.0001)  # -> RebarGroup, Mesh, Curve; disabled

# ==== cluster Cluster
T = ClusterInput()
i = ClusterInput()
graft = GraftTree(Tree=T, IncludeEmptyLists=True, IncludeNullItems=True)
medges = MeshEdges(Mesh=graft)  # -> NakedEdges, InteriorEdges, NonManifoldEdges
join = JoinCurves(Curves=medges.NakedEdges, Preserve=False)
explode = Explode(Curve=join, Recursive=True)  # -> Segments, Vertices
flip = FlipMatrix(Data=explode.Vertices)
pline = PolyLine(Vertices=flip, Closed=False)  # -> flatten(Polyline)
item = ListItem(List=pline, Index=i, Wrap=True)  # -> Item, Item1
explode_2 = Explode(Curve=item.Item1, Recursive=True)  # -> Segments, Vertices
explode_3 = Explode(Curve=item.Item, Recursive=True)  # -> Segments, Vertices
entwine = Entwine(Branch00=explode_3.Segments, Branch01=explode_2.Segments, FlattenInputs=True)
flip_2 = FlipMatrix(Data=entwine)
loft = Loft(Curves=flip_2, Options={Adjust=False, Closed=False, LoftEnds=0, LoftSimp=0, LoftType=0, Rebuild=10, Refit=0.01})
smesh = SimpleMesh(Brep=loft)
demesh = DeconstructMesh(Mesh=smesh)  # -> Vertices, Faces, Colours, Normals
item_2 = ListItem(List=demesh.Vertices, Index=0, Wrap=True)  # -> Item, Item1, Item2, Item3
ln = Line(StartPoint=item_2.Item, EndPoint=item_2.Item2)
ln_2 = Line(StartPoint=item_2.Item1, EndPoint=item_2.Item3)
merge = Merge(Data1=ln, Data2=ln_2)  # -> simplify(Result)
R = ClusterOutput(merge)
