# Grasshopper definition PalazzinaConControventi_EqualDOF_Test.gh (Grasshopper 1.0.7)
# plug-ins: Kangaroo2 Components

# ---- group: Element
data = Data(0)
data_2 = Data(0)

# ---- group: Load
# instagram:    Alpaca4d
# facebook:     Alpaca4d
# mail:         alpaca4d@gmail.com
data_3 = Data(0)
data_4 = Data(0)

# ---- group: Cross-Section
data_5 = Data(0)
data_6 = Data(0)

# ---- group: Support
data_7 = Data(0)
data_8 = Data(0)

# ---- group: Constraint
data_9 = Data(0)
data_10 = Data(0)

# ---- group: Material
data_11 = Data(0)
data_12 = Data(0)

# ----
dim_x = Slider(30, range=0..100)
dim_y = Slider(30, range=0..100)
int_x = Slider(5, range=0..100)
int_y = Slider(5, range=0..100)
n_piani = Slider(10, range=0..100)
rectangle = Rectangle(Plane=PlaneXY(0, 0, 0), XSize=dim_x, YSize=dim_y, Radius=0)  # -> Rectangle, Length

# ---- group: int Z
panel = Panel("4")

# ----
series = Series(Start=0, Step=panel, Count=n_piani)
mesh_uv = MeshSurface(Surface=rectangle.Rectangle, UCount=int_y, VCount=int_x, Overhang=True, Equalize=False)
Z = UnitZ(Factor=series)
angolo_max = Slider(0, range=0..360)
demesh = DeconstructMesh(Mesh=mesh_uv)  # -> Vertices, Faces, Colours, Normals
move = Move(Geometry=mesh_uv, Motion=Z)  # -> Geometry, Transform
dom = ConstructDomain(DomainStart=0, DomainEnd=angolo_max)
lng = ListLength(List=move.Geometry)
area = Area(Geometry=move.Geometry)  # -> Area, Centroid
range = Range(Domain=dom, Steps=expr("x-1", lng))
xy = XYPlane(Origin=area.Centroid)
rad = Radians(Degrees=range)
rotate = Rotate(Geometry=move.Geometry, Angle=rad, Plane=xy)  # -> Geometry, Transform
demesh_2 = DeconstructMesh(Mesh=rotate.Geometry)  # -> Vertices, Faces, Colours, Normals
cull_i = CullIndex(List=rotate.Geometry, Indices="0", Wrap=True)
flip = FlipMatrix(Data=demesh_2.Vertices)
pline = PolyLine(Vertices=flip, Closed=False)
warpweft = WarpWeft(Mesh=cull_i)  # -> Warp, Weft, NakedA, NakedB
medges = MeshEdges(Mesh=cull_i)  # -> NakedEdges, InteriorEdges, NonManifoldEdges
explode = Explode(Curve=pline, Recursive=True)  # -> Segments, Vertices

# ---- group: orditura 2
data_13 = Data(warpweft.Warp)

# ----
tstat = TreeStatistics(Tree=demesh_2.Vertices)  # -> Paths, Length, Count

# ---- group: orditura 1
data_14 = Data(warpweft.Weft)

# ----
item = ListItem(List=tstat.Paths, Index=0, Wrap=True)
midpt = CurveMiddle(Curve=data_13)
midpt_2 = CurveMiddle(Curve=data_14)
cluster = Cluster(T=rotate.Geometry, i=Slider(2, range=2..6))  # -> flatten(R)
cluster_2 = Cluster(T=rotate.Geometry, i=Slider(16, range=12..16))  # -> flatten(R)
cluster_3 = Cluster(T=rotate.Geometry, i=Slider(19, range=17..21))  # disabled
cluster_4 = Cluster(T=rotate.Geometry, i=Slider(9, range=7..11))  # disabled
pdecon = Deconstruct(Point=midpt)  # -> XComponent, YComponent, ZComponent
split = SplitTree(Data=demesh_2.Vertices, Masks=flatten(item))  # -> Positive, Negative
pdecon_2 = Deconstruct(Point=midpt_2)  # -> XComponent, YComponent, ZComponent
bnd = Bounds(Numbers=pdecon.XComponent)
bnd_2 = Bounds(Numbers=pdecon_2.YComponent)
merge = Merge(Data1=cluster_3, Data2=cluster_4, Data3=cluster, Data4=cluster_2)
dedomain = DeconstructDomain(Domain=bnd)  # -> Start, End
dedomain_2 = DeconstructDomain(Domain=bnd_2)  # -> Start, End

graft = GraftTree(Tree=rotate.Geometry, IncludeEmptyLists=True, IncludeNullItems=True)
medges_2 = MeshEdges(Mesh=graft)  # -> NakedEdges, InteriorEdges, NonManifoldEdges
join = JoinCurves(Curves=medges_2.NakedEdges, Preserve=False)
explode_2 = Explode(Curve=join, Recursive=True)  # -> Segments, Vertices
flip_2 = FlipMatrix(Data=explode_2.Vertices)
pline_2 = PolyLine(Vertices=flip_2, Closed=False)  # -> flatten(Polyline)
item_2 = ListItem(List=pline_2, Index=Slider(10, range=0..10), Wrap=True)  # -> Item, Item1
explode_3 = Explode(Curve=item_2.Item1, Recursive=True)  # -> Segments, Vertices
explode_4 = Explode(Curve=item_2.Item, Recursive=True)  # -> Segments, Vertices
entwine = Entwine(Branch00=explode_4.Segments, Branch01=explode_3.Segments, FlattenInputs=True)
flip_3 = FlipMatrix(Data=entwine)
loft = Loft(Curves=flip_3, Options={Adjust=False, Closed=False, LoftEnds=0, LoftSimp=0, LoftType=0, Rebuild=10, Refit=0.01})
smesh = SimpleMesh(Brep=loft)
demesh_3 = DeconstructMesh(Mesh=smesh)  # -> Vertices, Faces, Colours, Normals
item_3 = ListItem(List=demesh_3.Vertices, Index=0, Wrap=True)  # -> Item, Item1, Item2, Item3
ln = Line(StartPoint=item_3.Item, EndPoint=item_3.Item2)
ln_2 = Line(StartPoint=item_3.Item1, EndPoint=item_3.Item3)
merge_2 = Merge(Data1=ln, Data2=ln_2)  # -> simplify(Result)

smaller = SmallerThan(FirstNumber=pdecon.XComponent, SecondNumber=dedomain.Start)  # -> SmallerThan, OrEqualTo
larger = LargerThan(FirstNumber=pdecon.XComponent, SecondNumber=dedomain.End)  # -> LargerThan, OrEqualTo
data_15 = Data(split.Negative)
smaller_2 = SmallerThan(FirstNumber=pdecon_2.YComponent, SecondNumber=dedomain_2.Start)  # -> SmallerThan, OrEqualTo
larger_2 = LargerThan(FirstNumber=pdecon_2.YComponent, SecondNumber=dedomain_2.End)  # -> LargerThan, OrEqualTo
or = GateOr(A=smaller.OrEqualTo, B=larger.OrEqualTo)
avr = Average(Input=data_15)
or_2 = GateOr(A=smaller_2.OrEqualTo, B=larger_2.OrEqualTo)
dispatch = Dispatch(List=data_13, DispatchPattern=or)  # -> ListA, ListB
dispatch_2 = Dispatch(List=data_14, DispatchPattern=or_2)  # -> ListA, ListB
data_16 = Data(medges.NakedEdges)
rd = RigidDiaphgramAlpaca4d(masterNode=avr, slaveNodes=data_15)  # -> out, Constraint; inputs masterNode: Point3d, slaveNodes: list of Point3d; disabled
# ---------- rd: Python ----------
"""
Create a Diaphgram
-
    Args:
        masterNode:
        slaveNodes:
    Returns:
        Constraint:
"""


import sys
import Rhino.Geometry as rg
import Grasshopper as gh
import copy
from System.Drawing import Color


ghenv.Component.Name = "Rigid Diaphgram (Alpaca4d)"
ghenv.Component.NickName = 'RD'
ghenv.Component.Message = 'Rigid Diaphgram (Alpaca4d)'

## add alpaca install directory to system path

ghcompfolder = gh.Folders.DefaultAssemblyFolder
if ghcompfolder not in sys.path:
    sys.path.append(ghcompfolder)

try:
    from Alpaca4d import alpaca4d as alpaca
except:
    msg = "Cannot import Alpaca4d. Is the Alpaca4d folder available in " + ghcompfolder + "?"
    ghenv.Component.AddRuntimeMessage(gh.Kernel.GH_RuntimeMessageLevel.Error, msg)


checkData = True

if not masterNode:
    checkData = False
    msg = "Input parameter masterNode failed to collect data"
    ghenv.Component.AddRuntimeMessage(gh.Kernel.GH_RuntimeMessageLevel.Warning, msg)

if not slaveNodes:
    checkData = False
    msg = "Input parameter slaveNodes failed to collect data"
    ghenv.Component.AddRuntimeMessage(gh.Kernel.GH_RuntimeMessageLevel.Warning, msg)


if checkData:
    Constraint = alpaca.RigidDiaphragm(masterNode, slaveNodes)
# ---------- end rd ----------

# ---- group: Bordo
data_17 = Data(dispatch.ListA)

# ----
data_18 = Data(dispatch.ListB)

# ---- group: Bordo
data_19 = Data(medges.NakedEdges)

# ----
data_20 = Data(dispatch_2.ListB)
ext = ExtendCurve(Curve=merge_2, Type=0, Start="-0.9", End="-0.9")
end = EndPoints(Curve=merge_2)  # -> Start, End
end_2 = EndPoints(Curve=ext)  # -> Start, End
ln_3 = Line(StartPoint=end.Start, EndPoint=end_2.Start)
ln_4 = Line(StartPoint=end.End, EndPoint=end_2.End)
end_3 = EndPoints(Curve=ln_3)  # -> Start, End
end_4 = EndPoints(Curve=ln_4)  # -> Start, End
toggle = BooleanToggle(False)
ed = EqualDOFAlpaca4d(masterNode=end_3.Start, slaveNode=end_3.End)  # -> out, Constraint; inputs masterNode: Point3d, slaveNode: Point3d, dof_x: Boolean, dof_y: Boolean, dof_z: Boolean, dof_xx: Boolean, dof_yy: Boolean, dof_zz: Boolean
# ---------- ed: Python ----------
"""
Create an equalDOF constraint
-
    Args:
        masterNode:
        slaveNodes:
        dof_x:
        dof_y:
        dof_z:
        dof_xx:
        dof_yy:
        dof_zz:
    Returns:
        equalDOF:
"""

ghenv.Component.Name = "Equal DOF (Alpaca4d)"
ghenv.Component.NickName = 'ED'
ghenv.Component.Message = 'Equal DOF (Alpaca4d)'


import sys
import Rhino.Geometry as rg
import Grasshopper as gh
import copy
from System.Drawing import Color


## add alpaca install directory to system path

ghcompfolder = gh.Folders.DefaultAssemblyFolder
if ghcompfolder not in sys.path:
    sys.path.append(ghcompfolder)

try:
    from Alpaca4d import alpaca4d as alpaca
except:
    msg = "Cannot import Alpaca4d. Is the Alpaca4d folder available in " + ghcompfolder + "?"
    ghenv.Component.AddRuntimeMessage(gh.Kernel.GH_RuntimeMessageLevel.Error, msg)


checkData = True

if not masterNode:
    checkData = False
    msg = "Input parameter masterNode failed to collect data"
    ghenv.Component.AddRuntimeMessage(gh.Kernel.GH_RuntimeMessageLevel.Warning, msg)

if not slaveNode:
    checkData = False
    msg = "Input parameter masterNode failed to collect data"
    ghenv.Component.AddRuntimeMessage(gh.Kernel.GH_RuntimeMessageLevel.Warning, msg)

dof_x = True if dof_x is None else dof_x
dof_y = True if dof_y is None else dof_y
dof_z = True if dof_z is None else dof_z
dof_xx = True if dof_xx is None else dof_xx
dof_yy = True if dof_yy is None else dof_yy
dof_zz = True if dof_zz is None else dof_zz

if checkData:
    Constraint = alpaca.EqualDOF(masterNode, slaveNode, dof_x, dof_y, dof_z, dof_xx, dof_yy, dof_zz)
# ---------- end ed ----------
ed_2 = EqualDOFAlpaca4d(masterNode=end_4.Start, slaveNode=end_4.End, dof_yy=toggle, dof_zz=toggle)  # -> out, Constraint; inputs masterNode: Point3d, slaveNode: Point3d, dof_x: Boolean, dof_y: Boolean, dof_z: Boolean, dof_xx: Boolean, dof_yy: Boolean, dof_zz: Boolean; same code as ed
data_21 = Data(flatten([ed.Constraint, ed_2.Constraint]))
duppt = RemoveDuplicatePts(Points=data_15, Tolerance=0.01)

# ---- group: da MPa a KN/m2
multiplication = Multiplication(A=Slider(30000, range=0..100000), B="1000")

# ----
addition = Addition(A="0.3", B="2")
division = Division(A=multiplication, B=addition)

# ----
# nDMaterial
# ElasticIsotropic
python = GhPythonScript(E=multiplication, v="0.3", rho="25")  # -> out, nDMaterial
# ---------- python: Python ----------
"""
Create a support
-
    Args:
        name:
        E:
        G:
        v:
        rho:
    Returns:
        nDMaterial:
"""


import sys
import Rhino.Geometry as rg
import Grasshopper as gh
import copy


## add alpaca install directory to system path

ghcompfolder = gh.Folders.DefaultAssemblyFolder
if ghcompfolder not in sys.path:
    sys.path.append(ghcompfolder)

try:
    from Alpaca4d import alpaca4d as alpaca
except:
    msg = "Cannot import Alpaca4d. Is the Alpaca4d folder available in " + ghcompfolder + "?"
    ghenv.Component.AddRuntimeMessage(gh.Kernel.GH_RuntimeMessageLevel.Error, msg)


checkData = True

if not E:
    checkData = False
    msg = "Input parameter E failed to collect data"
    ghenv.Component.AddRuntimeMessage(gh.Kernel.GH_RuntimeMessageLevel.Warning, msg)

if not G and not v:
    checkData = False
    msg = "Input parameter G or v failed to collect data"
    ghenv.Component.AddRuntimeMessage(gh.Kernel.GH_RuntimeMessageLevel.Warning, msg)

if not rho:
    checkData = False
    msg = "Input parameter rho failed to collect data"
    ghenv.Component.AddRuntimeMessage(gh.Kernel.GH_RuntimeMessageLevel.Warning, msg)

if checkData:
    nDMaterial = alpaca.ElasticIsotropic(name, E, G, rho, v)
# ---------- end python ----------

division_2 = Division(A="25", B="9.81")

# ----
# uniAxial
panel_2 = Panel("S235")
ghpython_script = GhPythonScript(name=panel_2, E=multiplication, eta=Slider(9.55, range=5..20), G=division, v="0.3", rho=division_2)  # -> out, steel
# ---------- ghpython_script: Python ----------
try:
    from Alpaca4d import alpaca4d as alpaca
except:
    msg = "Cannot import Alpaca4d. Is the Alpaca4d folder available in " + ghcompfolder + "?"
    ghenv.Component.AddRuntimeMessage(gh.Kernel.GH_RuntimeMessageLevel.Error, msg)

steel = alpaca.uniAxialMaterialElastic(name, E, Eneg, eta, G, v, rho)


print(steel.Eneg)



print(steel.write_tcl())
# ---------- end ghpython_script ----------

panel_3 = Panel("0.025")
number_slider = Slider(0.5, range=0..1)

area_2 = Area(Geometry=mesh_uv)  # -> Area, Centroid
lng_2 = ListLength(List=demesh.Vertices)
division_3 = Division(A=area_2.Area, B=lng_2)
multiplication_2 = Multiplication(A="-10", B=division_3)

# ----
# Constant Time Series
python_2 = GhPythonScript(constantFactor="1")  # -> timeSeries, Graph
# ---------- python_2: Python ----------
"""
Create a PointLoad
-
    Args:
        tStart:
        tEnd:
        period:
        factor:
        shift:
    Returns:
        timeSeries:
        Graph:
"""

import sys
import Rhino.Geometry as rg
import Grasshopper as gh
import copy
import math


## add alpaca install directory to system path

ghcompfolder = gh.Folders.DefaultAssemblyFolder
if ghcompfolder not in sys.path:
    sys.path.append(ghcompfolder)

try:
    from Alpaca4d import alpaca4d as alpaca
except:
    msg = "Cannot import Alpaca4d. Is the Alpaca4d folder available in " + ghcompfolder + "?"
    ghenv.Component.AddRuntimeMessage(gh.Kernel.GH_RuntimeMessageLevel.Error, msg)

def ConstantSeries(x):
    return x



checkData = True

if not constantFactor:
    constantFactor = 1


if checkData:
    timeSeries = alpaca.TimeSeriesConstant(constantFactor)
    
    Graph = []
    
    for x in range(10):
        Graph.append(ConstantSeries(constantFactor))
# ---------- end python_2 ----------

rectangular_cross_section = RectangularCrossSectionAlpaca4d(b=Slider(0.3, range=0..1), h=Slider(0.7, range=0..1), material=ghpython_script.steel)  # -> out, CrossSection
# ---------- rectangular_cross_section: Python ----------
"""
Create a Rectangular Cross Section
-
    Args:
        secName:
        Area:
        Izz:
        Iyy:
        J:
        alphaY:
        alphaZ:
        material:
    Returns:
        genericSection:
"""


import sys
import Rhino.Geometry as rg
import Grasshopper as gh
import copy


## add alpaca install directory to system path

ghcompfolder = gh.Folders.DefaultAssemblyFolder
if ghcompfolder not in sys.path:
    sys.path.append(ghcompfolder)

try:
    from Alpaca4d import alpaca4d as alpaca
except:
    msg = "Cannot import Alpaca4d. Is the Alpaca4d folder available in " + ghcompfolder + "?"
    ghenv.Component.AddRuntimeMessage(gh.Kernel.GH_RuntimeMessageLevel.Error, msg)


checkData = True

if not b:
    checkData = False
    msg = "Input parameter b failed to collect data"
    ghenv.Component.AddRuntimeMessage(gh.Kernel.GH_RuntimeMessageLevel.Warning, msg)

if not h:
    checkData = False
    msg = "Input parameter h failed to collect data"
    ghenv.Component.AddRuntimeMessage(gh.Kernel.GH_RuntimeMessageLevel.Warning, msg)

if not material:
    checkData = False
    msg = "Input parameter material failed to collect data"
    ghenv.Component.AddRuntimeMessage(gh.Kernel.GH_RuntimeMessageLevel.Warning, msg)



if checkData:
    rectCS = alpaca.RectangularCS(b,h,material)
    CrossSection = alpaca.ElasticSection(secName, rectCS.Area(), rectCS.Izz(), rectCS.Iyy(), rectCS.J(), rectCS.alphaY, rectCS.alphaZ, rectCS.material)
    CrossSection.sectionBrep = rectCS.sectionBrep
    CrossSection.crv = rectCS.crv
# ---------- end rectangular_cross_section ----------
rectangular_cross_section_2 = RectangularCrossSectionAlpaca4d(b=Slider(0.7, range=0..1), h=Slider(0.3, range=0..1), material=ghpython_script.steel)  # -> out, CrossSection; same code as rectangular_cross_section
rectangular_cross_section_3 = RectangularCrossSectionAlpaca4d(b=Slider(0.3, range=0..1), h=Slider(0.7, range=0..1), material=ghpython_script.steel)  # -> out, CrossSection; same code as rectangular_cross_section
merge_3 = Merge(Data1=data_17, Data2=data_19)
abs = Absolute(Value=multiplication_2)
ghpython_script_2 = GhPythonScript(Line=data_20, CrossSection=rectangular_cross_section_3.CrossSection, Colour=ColourSwatch(SwatchColor=RGB(64, 210, 255)))  # -> out, flatten(element); inputs Line: Curve, Colour: Color, Orient: Boolean
# ---------- ghpython_script_2: Python ----------
try:
    from Alpaca4d import alpaca4d as alpaca
except:
    msg = "Cannot import Alpaca4d. Is the Alpaca4d folder available in " + ghcompfolder + "?"
    ghenv.Component.AddRuntimeMessage(gh.Kernel.GH_RuntimeMessageLevel.Error, msg)
import copy


newCrossSection = copy.deepcopy(CrossSection)

if not Colour:
    Colour = Color.Red

if Orient is None:
    Orient = 0.0

element = alpaca.ForceBeamColumn(Line, newCrossSection, Colour, Orient)
# ---------- end ghpython_script_2 ----------
ghpython_script_3 = GhPythonScript(Line=merge_3, CrossSection=rectangular_cross_section.CrossSection, Colour=ColourSwatch(SwatchColor=RGB(255, 64, 150)))  # -> out, flatten(element); inputs Line: Curve, Colour: Color, Orient: Boolean; same code as ghpython_script_2
ghpython_script_4 = GhPythonScript(Line=data_18, CrossSection=rectangular_cross_section_2.CrossSection, Colour=ColourSwatch(SwatchColor=RGB(255, 223, 64)))  # -> out, flatten(element); inputs Line: Curve, Colour: Color, Orient: Boolean; same code as ghpython_script_2
multiplication_3 = Multiplication(A=abs, B="0.05")
vec = VectorXYZ(XComponent=multiplication_3, YComponent=0, ZComponent=multiplication_2)  # -> Vector, Length
toggle_2 = BooleanToggle(True)
toggle_3 = BooleanToggle(True)
# PointLoad
pl = PointLoadAlpaca4d(Pos=duppt, Force=vec.Vector, TimeSeries=python_2.timeSeries)  # -> out, PointLoad; inputs Pos: Point3d, Force: Vector3d, Moment: Vector3d
# ---------- pl: Python ----------
"""
Create a Point Load
-
    Args:
        Pos:
        Force:
        Moment:
        TimeSeries:
    Returns:
        PointLoad:
"""

ghenv.Component.Name = "Point Load (Alpaca4d)"
ghenv.Component.NickName = 'PL'
ghenv.Component.Message = "Point Load (Alpaca4d)"



import sys
import Rhino.Geometry as rg
import Grasshopper as gh
import copy


## add alpaca install directory to system path

ghcompfolder = gh.Folders.DefaultAssemblyFolder
if ghcompfolder not in sys.path:
    sys.path.append(ghcompfolder)

try:
    from Alpaca4d import alpaca4d as alpaca
except:
    msg = "Cannot import Alpaca4d. Is the Alpaca4d folder available in " + ghcompfolder + "?"
    ghenv.Component.AddRuntimeMessage(gh.Kernel.GH_RuntimeMessageLevel.Error, msg)


checkData = True

if not Pos:
    checkData = False
    msg = "Input parameter Pos failed to collect data"
    ghenv.Component.AddRuntimeMessage(gh.Kernel.GH_RuntimeMessageLevel.Warning, msg)

if not Force:
    Force = rg.Vector3d(0,0,0)

if not Moment:
    Moment = rg.Vector3d(0,0,0)

if not TimeSeries:
    checkData = False
    msg = "Input parameter TimeSeries failed to collect data"
    ghenv.Component.AddRuntimeMessage(gh.Kernel.GH_RuntimeMessageLevel.Warning, msg)


if checkData:
    PointLoad = alpaca.PointLoad(Pos, Force, Moment, TimeSeries)
# ---------- end pl ----------
pl_2 = PointLoadAlpaca4d(Pos=flatten(avr), Force=vec.Vector, TimeSeries=python_2.timeSeries)  # -> out, PointLoad; inputs Pos: Point3d, Force: Vector3d, Moment: Vector3d; disabled; same code as pl
support = SupportAlpaca4d(Pos=avr, Tx=False, Ty=False, Tz=Toggle(True), Rx=toggle_2, Ry=toggle_2, Rz=False)  # -> flatten(Support); inputs Pos: Point3d, Tx: Boolean, Ty: Boolean, Tz: Boolean, Rx: Boolean, Ry: Boolean, Rz: Boolean; disabled
# ---------- support: Python ----------
"""
Create a support
-
    Args:
        Pos:
        Tx:
        Ty:
        Tz:
        Rx:
        Ry:
    Returns:
        Support:
"""

ghenv.Component.Name = "Support (Alpaca4d)"
ghenv.Component.NickName = 'Support'
ghenv.Component.Message = "Support (Alpaca4d)"


import sys
import Rhino.Geometry as rg
import Grasshopper as gh


## add alpaca install directory to system path

ghcompfolder = gh.Folders.DefaultAssemblyFolder
if ghcompfolder not in sys.path:
    sys.path.append(ghcompfolder)

try:
    from Alpaca4d import alpaca4d as alpaca
except:
    msg = "Cannot import Alpaca4d. Is the Alpaca4d folder available in " + ghcompfolder + "?"
    ghenv.Component.AddRuntimeMessage(gh.Kernel.GH_RuntimeMessageLevel.Error, msg)

checkData = True


if not Pos:
    checkData = False
    msg = "Input parameter Pos failed to collect data"
    ghenv.Component.AddRuntimeMessage(gh.Kernel.GH_RuntimeMessageLevel.Warning, msg)

if checkData:
    Support = alpaca.Support(Pos, Tx, Ty, Tz, Rx, Ry, Rz)
# ---------- end support ----------
support_2 = SupportAlpaca4d(Pos=split.Positive, Tx=toggle_3, Ty=toggle_3, Tz=toggle_3, Rx=toggle_3, Ry=toggle_3, Rz=toggle_3)  # -> Support; inputs Pos: Point3d, Tx: Boolean, Ty: Boolean, Tz: Boolean, Rx: Boolean, Ry: Boolean, Rz: Boolean; same code as support
panel_4 = Panel(data_21)
as = AnalysisSettingsAlpaca4d(Algorithm="KrylovNewton", AnalysisSteps="1")  # -> out, Analysis
# ---------- as: Python ----------
"""
Create Analysis settings
-
    Args:
        Constraint: 'Plain', 'Transformation'. Default is 'Transformation'.
        Numberer: 'RCM', 'AMD', 'Plain'. Default is 'RCM'.
        System: 'BandGen', 'BandSPD', 'ProfileSPD', 'SuperLU', 'UmfPack', 'FullGeneral', 'SparseSYM'. Default is 'BandSPD'.
        Test: Feature not implemented. Please contact alpaca4d@gmail.com 
        Algorithm: 'Linear', 'Newton', 'NewtonLineSearch', 'ModifiedNewton', 'KrylovNewton', 'SecantNewton', 'BFGS', 'Broyden'. Default is 'Linear'.
        Integrator: Default is LoadControl.
        AnalysisType: 'Static', 'Transient'. Default is 'Static'.
        AnalyesSteps:
    Returns:
        Analysis:
"""

import sys
import os


import clr
import clrtype
import Rhino.Geometry as rg
import rhinoscriptsyntax as rs
import Grasshopper as gh
import copy
import ghpythonlib.treehelpers as th


ghenv.Component.Name = "Analysis settings (Alpaca4d)"
ghenv.Component.NickName = 'AS'
ghenv.Component.Message = "Analysis settings \n(Alpaca4d)"



from Alpaca4d import alpaca4d as alpaca

checkData = True


# default Value
Constraint = 'Transformation' if Constraint is None else Constraint
ConstraintList = ['Plain', 'Transformation']

for item in ConstraintList:
    if Constraint.lower() == item.lower():
        print(item)
        Constraint = item


# default Value
Numberer = 'RCM' if Numberer is None else Numberer
NumbererList = ['RCM', 'AMD', 'Plain', 'ParallelPlain', 'ParallelRCM']

for i,item in enumerate(NumbererList):
    if Numberer.lower() == item.lower():
        Numberer = item



# default Value
System = 'BandSPD' if System is None else System
SystemList = ['BandGen', 'BandSPD', 'ProfileSPD', 'SuperLU', 'UmfPack', 'FullGeneral', 'SparseSYM']

for i,item in enumerate(SystemList):
    if System.lower() == item.lower():
        System = item


# default Test
Test = 'NormDispIncr 1.0e-6 12 5' if Test is None else Test




# default Value
Algorithm = 'Linear' if Algorithm is None else Algorithm
AlgorithmList = ['Linear', 'Newton', 'NewtonLineSearch', 'ModifiedNewton', 'KrylovNewton', 'SecantNewton', 'BFGS', 'Broyden']

for i,item in enumerate(AlgorithmList):
    if Algorithm.lower() == item.lower():
        Algorithm = item


# default Value
AnalysisType = 'Static' if AnalysisType is None else AnalysisType
AnalysisTypeList = ['Static', 'Transient']

for item in AnalysisTypeList:
    if AnalysisType.lower() == item.lower():
        AnalysisType = item


## Define Integrator
if AnalysisType == "Static":
    Integrator = "LoadControl 1.0" if Integrator is None else Integrator
elif AnalysisType == "Transien":
    Integrator = "Newmark 0.5 0.25" if Integrator is None else Integrator



if not AnalysisSteps:
    checkData = False
    msg = "Input parameter AnalysisSteps failed to collect data"
    ghenv.Component.AddRuntimeMessage(gh.Kernel.GH_RuntimeMessageLevel.Warning, msg)


if checkData:
    Analysis = alpaca.Analysis(Constraint, Numberer,System,Test,Algorithm,Integrator,AnalysisType, AnalysisSteps)
    print(Analysis.write_tcl())
# ---------- end as ----------
gradientlibrary = GradientLibrary(gradIndex=Slider(1, range=1..12))  # -> colors; inputs gradIndex: Int32
#   port colors: A series of colors to be plugged into the "Ladybug_Legend Parameters" component.
# ---------- gradientlibrary: Python ----------
"""
Preset of gradient colors perfect for Data Visualisation
    Inputs:
        gradIndex: An index refering to one of the following possible gradients:
            0 - Orignal Ladybug
            1 - Nuanced Ladybug
            2 - Multi-colored Ladybug
            3 - Ecotect
            4 - Thermal Comfort Percentage
            5 - Thermal Comfort Colors
            6 - Shade Benefit/Harm
            7 - Shade Harm
            8 - Shade Benefit
            9 - CFD Colors 1
            10 - Radiation Benefit
            11 - Gsa10 Colour
            12 - Gsa9 Colour
    Returns:
        customColors: A series of colors.
"""

ghenv.Component.Name = "Gradient Library"
ghenv.Component.NickName = 'GradientLibrary'
#ghenv.Component.Message = 'GradientLibrary\nWIP'

import scriptcontext as sc
import Grasshopper.Kernel as gh
import System

gradientLibrary = {
        0: [System.Drawing.Color.FromArgb(75, 107, 169), System.Drawing.Color.FromArgb(115, 147, 202), System.Drawing.Color.FromArgb(170, 200, 247), System.Drawing.Color.FromArgb(193, 213, 208), System.Drawing.Color.FromArgb(245, 239, 103), System.Drawing.Color.FromArgb(252, 230, 74), System.Drawing.Color.FromArgb(239, 156, 21), System.Drawing.Color.FromArgb(234, 123, 0), System.Drawing.Color.FromArgb(234, 74, 0), System.Drawing.Color.FromArgb(234, 38, 0)],
        1: [System.Drawing.Color.FromArgb(49,54,149), System.Drawing.Color.FromArgb(69,117,180), System.Drawing.Color.FromArgb(116,173,209), System.Drawing.Color.FromArgb(171,217,233), System.Drawing.Color.FromArgb(224,243,248), System.Drawing.Color.FromArgb(255,255,191), System.Drawing.Color.FromArgb(254,224,144), System.Drawing.Color.FromArgb(253,174,97), System.Drawing.Color.FromArgb(244,109,67), System.Drawing.Color.FromArgb(215,48,39), System.Drawing.Color.FromArgb(165,0,38)],
        2: [System.Drawing.Color.FromArgb(4,25,145), System.Drawing.Color.FromArgb(7,48,224), System.Drawing.Color.FromArgb(7,88,255), System.Drawing.Color.FromArgb(1,232,255), System.Drawing.Color.FromArgb(97,246,156), System.Drawing.Color.FromArgb(166,249,86), System.Drawing.Color.FromArgb(254,244,1), System.Drawing.Color.FromArgb(255,121,0), System.Drawing.Color.FromArgb(239,39,0), System.Drawing.Color.FromArgb(138,17,0)],
        3: [System.Drawing.Color.FromArgb(0,0,255), System.Drawing.Color.FromArgb(53,0,202), System.Drawing.Color.FromArgb(107,0,148), System.Drawing.Color.FromArgb(160,0,95), System.Drawing.Color.FromArgb(214,0,41), System.Drawing.Color.FromArgb(255,12,0), System.Drawing.Color.FromArgb(255,66,0), System.Drawing.Color.FromArgb(255,119,0), System.Drawing.Color.FromArgb(255,173,0), System.Drawing.Color.FromArgb(255,226,0), System.Drawing.Color.FromArgb(255,255,0)],
        4: [System.Drawing.Color.FromArgb(0,0,0), System.Drawing.Color.FromArgb(110,0,153), System.Drawing.Color.FromArgb(255,0,0), System.Drawing.Color.FromArgb(255,255,102), System.Drawing.Color.FromArgb(255,255,255)],
        5: [System.Drawing.Color.FromArgb(0,136,255), System.Drawing.Color.FromArgb(200,225,255), System.Drawing.Color.FromArgb(255,255,255), System.Drawing.Color.FromArgb(255,230,230), System.Drawing.Color.FromArgb(255,0,0)],
        6: [System.Drawing.Color.FromArgb(5,48,97), System.Drawing.Color.FromArgb(33,102,172), System.Drawing.Color.FromArgb(67,147,195), System.Drawing.Color.FromArgb(146,197,222), System.Drawing.Color.FromArgb(209,229,240), System.Drawing.Color.FromArgb(255,255,255), System.Drawing.Color.FromArgb(253,219,199), System.Drawing.Color.FromArgb(244,165,130), System.Drawing.Color.FromArgb(214,96,77), System.Drawing.Color.FromArgb(178,24,43), System.Drawing.Color.FromArgb(103,0,31)],
        7: [System.Drawing.Color.FromArgb(255,255,255), System.Drawing.Color.FromArgb(253,219,199), System.Drawing.Color.FromArgb(244,165,130), System.Drawing.Color.FromArgb(214,96,77), System.Drawing.Color.FromArgb(178,24,43), System.Drawing.Color.FromArgb(103,0,31)],
        8: [System.Drawing.Color.FromArgb(255,255,255), System.Drawing.Color.FromArgb(209,229,240), System.Drawing.Color.FromArgb(146,197,222), System.Drawing.Color.FromArgb(67,147,195), System.Drawing.Color.FromArgb(33,102,172), System.Drawing.Color.FromArgb(5,48,97)],
        9: [System.Drawing.Color.FromArgb(0,16,120), System.Drawing.Color.FromArgb(38,70,160), System.Drawing.Color.FromArgb(5,180,222), System.Drawing.Color.FromArgb(16,180,109), System.Drawing.Color.FromArgb(59,183,35), System.Drawing.Color.FromArgb(143,209,19), System.Drawing.Color.FromArgb(228,215,29), System.Drawing.Color.FromArgb(246,147,17), System.Drawing.Color.FromArgb(243,74,0), System.Drawing.Color.FromArgb(255,0,0)],
        10: [System.Drawing.Color.FromArgb(0,191,48), System.Drawing.Color.FromArgb(255,238,184), System.Drawing.Color.FromArgb(255,0,0)],
        11: [System.Drawing.Color.FromArgb(204,0,71), System.Drawing.Color.FromArgb(255,182,71), System.Drawing.Color.FromArgb(206,255,115), System.Drawing.Color.FromArgb(26,180, 214),System.Drawing.Color.FromArgb(0,0,207)],
        12: [System.Drawing.Color.FromArgb(255, 51, 51), System.Drawing.Color.FromArgb(255, 170, 51), System.Drawing.Color.FromArgb(255, 255, 51), System.Drawing.Color.FromArgb(170, 255, 125), System.Drawing.Color.FromArgb(51, 255, 231), System.Drawing.Color.FromArgb(51, 170, 255), System.Drawing.Color.FromArgb(51,51, 255)]}
colors = gradientLibrary[gradIndex]
# ---------- end gradientlibrary ----------
num = Number("150e-0")
multiplication_4 = Multiplication(A=panel, B=n_piani)
division_4 = Division(A=multiplication_4, B="300")

midpt_3 = CurveMiddle(Curve=merge)
pdecon_3 = Deconstruct(Point=midpt_3)  # -> XComponent, YComponent, ZComponent
sort = SortList(Keys=pdecon_3.ZComponent, ValuesA=merge)  # -> Keys, ValuesA
dom_2 = ConstructDomain(DomainStart="0.1", DomainEnd="0.01")

# ---- group: colonne
data_22 = Data(flatten(sort.ValuesA))

# ----
lng_3 = ListLength(List=data_22)
division_5 = Division(A=lng_3, B=Slider(6, range=0..10))
partition = PartitionList(List=data_22, Size=division_5)
tstat_2 = TreeStatistics(Tree=partition)  # -> Paths, Length, Count
range_2 = Range(Domain=dom_2, Steps=expr("x-1", tstat_2.Count))
graft_2 = GraftTree(Tree=range_2, IncludeEmptyLists=True, IncludeNullItems=True)

gs = GenericSectionAlpaca4d(
    Area=graft_2,
    Izz="0.0000000001",
    Iyy="0.0000000001",
    J="0.0000000001",
    alphaY="0.5",
    alphaZ="0.5",
    material=ghpython_script.steel)  # -> out, Section
# ---------- gs: Python ----------
"""
Create a Generic Cross Section
-
    Args:
        secName:
        Area:
        Izz:
        Iyy:
        J:
        alphaY:
        alphaZ:
        material:
    Returns:
        genericSection:
"""

ghenv.Component.Name = "Generic Section (Alpaca4d)"
ghenv.Component.NickName = 'GS'
ghenv.Component.Message = "Generic Section (Alpaca4d)"

import sys
import Rhino.Geometry as rg
import Grasshopper as gh
import copy
import math as mt


## add alpaca install directory to system path

ghcompfolder = gh.Folders.DefaultAssemblyFolder
if ghcompfolder not in sys.path:
    sys.path.append(ghcompfolder)

try:
    from Alpaca4d import alpaca4d as alpaca
except:
    msg = "Cannot import Alpaca4d. Is the Alpaca4d folder available in " + ghcompfolder + "?"
    ghenv.Component.AddRuntimeMessage(gh.Kernel.GH_RuntimeMessageLevel.Error, msg)


checkData = True

if not Area:
    checkData = False
    msg = "Input parameter Area failed to collect data"
    ghenv.Component.AddRuntimeMessage(gh.Kernel.GH_RuntimeMessageLevel.Warning, msg)

if not Izz:
    checkData = False
    msg = "Input parameter Izz failed to collect data"
    ghenv.Component.AddRuntimeMessage(gh.Kernel.GH_RuntimeMessageLevel.Warning, msg)

if not Iyy:
    checkData = False
    msg = "Input parameter Iyy failed to collect data"
    ghenv.Component.AddRuntimeMessage(gh.Kernel.GH_RuntimeMessageLevel.Warning, msg)

if not J:
    checkData = False
    msg = "Input parameter J failed to collect data"
    ghenv.Component.AddRuntimeMessage(gh.Kernel.GH_RuntimeMessageLevel.Warning, msg)

if not alphaY:
    checkData = False
    msg = "Input parameter alphaY failed to collect data"
    ghenv.Component.AddRuntimeMessage(gh.Kernel.GH_RuntimeMessageLevel.Warning, msg)

if not alphaZ:
    checkData = False
    msg = "Input parameter alphaZ failed to collect data"
    ghenv.Component.AddRuntimeMessage(gh.Kernel.GH_RuntimeMessageLevel.Warning, msg)

if not material:
    checkData = False
    msg = "Input parameter material failed to collect data"
    ghenv.Component.AddRuntimeMessage(gh.Kernel.GH_RuntimeMessageLevel.Warning, msg)




if checkData:
    Section = alpaca.ElasticSection(secName, Area, Izz, Iyy, J, alphaY, alphaZ, material)
    d = 2*mt.sqrt(Area/mt.pi)
    Section.crv = rg.Circle(rg.Plane.WorldXY, d).ToNurbsCurve( 2, 10 )
    Section.sectionBrep = rg.Brep.CreatePlanarBreps( Section.crv, 0.1 )[0]
# ---------- end gs ----------
ghpython_script_5 = GhPythonScript(Line=ext, CrossSection=gs.Section, Colour=ColourSwatch(SwatchColor=RGB(195, 255, 0)))  # -> out, element; inputs Line: Curve, Colour: Color, Orient: Boolean; same code as ghpython_script_2

flip_4 = FlipMatrix(Data=explode.Segments)
dom_3 = ConstructDomain(DomainStart="1.25", DomainEnd="0.5")

# ---- group: colonne
data_23 = Data(flatten(flip_4))

# ----
lng_4 = ListLength(List=data_23)
division_6 = Division(A=lng_4, B=Slider(6, range=0..10))
partition_2 = PartitionList(List=data_23, Size=division_6)
tstat_3 = TreeStatistics(Tree=partition_2)  # -> Paths, Length, Count
range_3 = Range(Domain=dom_3, Steps=expr("x-1", tstat_3.Count))
graft_3 = GraftTree(Tree=range_3, IncludeEmptyLists=True, IncludeNullItems=True)

division_7 = Division(A=graft_3, B="2")
circle_cross_section = CircleCrossSectionAlpaca4d(d=graft_3, t=division_7, material=ghpython_script.steel)  # -> out, CrossSection
# ---------- circle_cross_section: Python ----------
"""
Create a Circle Cross Section
-
    Args:
        secName:
        Area:
        Izz:
        Iyy:
        J:
        alphaY:
        alphaZ:
        material:
    Returns:
        genericSection:
"""


import sys
import Rhino.Geometry as rg
import Grasshopper as gh
import copy


## add alpaca install directory to system path

ghcompfolder = gh.Folders.DefaultAssemblyFolder
if ghcompfolder not in sys.path:
    sys.path.append(ghcompfolder)

try:
    from Alpaca4d import alpaca4d as alpaca
except:
    msg = "Cannot import Alpaca4d. Is the Alpaca4d folder available in " + ghcompfolder + "?"
    ghenv.Component.AddRuntimeMessage(gh.Kernel.GH_RuntimeMessageLevel.Error, msg)


checkData = True

if not d:
    checkData = False
    msg = "Input parameter d failed to collect data"
    ghenv.Component.AddRuntimeMessage(gh.Kernel.GH_RuntimeMessageLevel.Warning, msg)

if not t:
    checkData = False
    msg = "Input parameter t failed to collect data"
    ghenv.Component.AddRuntimeMessage(gh.Kernel.GH_RuntimeMessageLevel.Warning, msg)

if not material:
    checkData = False
    msg = "Input parameter material failed to collect data"
    ghenv.Component.AddRuntimeMessage(gh.Kernel.GH_RuntimeMessageLevel.Warning, msg)



if checkData:
    circleCS = alpaca.CircleCS(d,t,material)
    CrossSection = alpaca.ElasticSection(secName, circleCS.Area(), circleCS.Izz(), circleCS.Iyy(), circleCS.J(), circleCS.alphaY, circleCS.alphaZ, circleCS.material)
    CrossSection.sectionBrep = circleCS.sectionBrep
    CrossSection.crv = circleCS.crv
# ---------- end circle_cross_section ----------
ghpython_script_6 = GhPythonScript(Line=partition_2, CrossSection=circle_cross_section.CrossSection, Colour=ColourSwatch(SwatchColor=RGB(153, 11, 11)))  # -> out, element; inputs Line: Curve, Colour: Color, Orient: Boolean; same code as ghpython_script_2
am = AssembleModelAlpaca4d(
    Element=flatten([ghpython_script_4.element, ghpython_script_6.element, ghpython_script_2.element, ghpython_script_3.element, ghpython_script_5.element]),
    Support=flatten([support_2, support]),
    Load=flatten([pl.PointLoad, pl_2.PointLoad]),
    Constraint=flatten([rd.Constraint, data_21]))  # -> out, AlpacaModel, Mass; inputs Element: list, Support: list, Load: list, Constraint: list
# ---------- am: Python ----------
"""
Create a FEA Model
-
    Args:
        Element:
        Support:
        Load:
        Constraint:
    Returns:
        AlpacaModel:
"""

ghenv.Component.Name = "Assemble Model (Alpaca4d)"
ghenv.Component.NickName = 'AM'
ghenv.Component.Message = "Assemble Model (Alpaca4d)"




import os
import sys
from Alpaca4d import alpaca4d as alpaca
import ghpythonlib.treehelpers as th
import Rhino.Geometry as rg
import Rhino.Collections as rc
import rhinoscriptsyntax as rs
from collections import defaultdict, OrderedDict
import copy
import time
import Grasshopper as gh

## add alpaca install directory to system path

ghcompfolder = gh.Folders.DefaultAssemblyFolder
if ghcompfolder not in sys.path:
    sys.path.append(ghcompfolder)

try:
    from Alpaca4d import alpaca4d as alpaca
except:
    msg = "Cannot import Alpaca4d. Is the Alpaca4d folder available in " + ghcompfolder + "?"
    ghenv.Component.AddRuntimeMessage(gh.Kernel.GH_RuntimeMessageLevel.Error, msg)


checkData = True

if not Element:
    checkData = False
    msg = "Input parameter Element failed to collect data"
    ghenv.Component.AddRuntimeMessage(gh.Kernel.GH_RuntimeMessageLevel.Warning, msg)

if not Support:
    checkData = False
    msg = "Input parameter Support failed to collect data"
    ghenv.Component.AddRuntimeMessage(gh.Kernel.GH_RuntimeMessageLevel.Warning, msg)


if checkData:
    
    FolderPath = rs.DocumentPath()
    os.chdir(FolderPath)
    
    # create the object model
    AlpacaModel = alpaca.Model()
    
    
    start = time.clock()
    #subdivide element per type
    
    for element in Element:
        if element.type == "Beam":
            AlpacaModel.beams.append(element)
        elif element.type == "Shell":
            AlpacaModel.shells.append(element)
        elif element.type == "Brick":
            AlpacaModel.bricks.append(element)
    
    end = time.clock() - start
    print("time to subdivide element {}".format(end))
    start = time.clock()
    
    # create a list of unique point
    # need to add the rigid constraint
    
    AlpacaModel.getuniquePoints(AlpacaModel.beams, AlpacaModel.shells, AlpacaModel.bricks, Constraint)
    
    
    end = time.clock() - start
    print("time to get uniquepoints {}".format(end))
    start = time.clock()
    
    
    #############
    # create node and assign to object
    #############
    
    if AlpacaModel.uniquePointsThreeNDF:
        AlpacaModel.py.append(alpaca.Model.write3ndf_tcl())
        for point in AlpacaModel.uniquePointsThreeNDF:
            node = alpaca.Node(point)
            node.ndf = 3
            node.setNodeTag(AlpacaModel)
            AlpacaModel.nodes.append( node )
        
            AlpacaModel.py.append(node.write_tcl())
    
    
    if AlpacaModel.uniquePointsSixNDF:
        AlpacaModel.py.append(alpaca.Model.write6ndf_tcl())
        for point in AlpacaModel.uniquePointsSixNDF:
            node = alpaca.Node(point)
            node.ndf = 6
            node.setNodeTag(AlpacaModel)
            AlpacaModel.nodes.append( node )
         
            AlpacaModel.py.append(node.write_tcl())
    
    
    
    end = time.clock() - start
    print("time to create node and assign tag {}".format(end))
    start = time.clock()
    
    
    #################
    # create supports
    #################
    
    for supportNode in Support:
        
        # if the list is empty, skip this operation
        if AlpacaModel.uniquePointsThreeNDF:
            closestPointInThreeNDF = rc.Point3dList.ClosestPointInList(AlpacaModel.uniquePointsThreeNDF, supportNode.Pos)
            if supportNode.Pos.DistanceTo(closestPointInThreeNDF) < 0.001:
                #print("I am in 3ndf")
                supportNode.ndf = 3
                AlpacaModel.threeNDFModel.append(supportNode)
                supportNode.setNodeTag(AlpacaModel)
        
        if AlpacaModel.uniquePointsSixNDF:
            closestPointInSixNDF = rc.Point3dList.ClosestPointInList(AlpacaModel.uniquePointsSixNDF, supportNode.Pos)
            if supportNode.Pos.DistanceTo(closestPointInSixNDF) < 0.001:
                supportNode.ndf = 6
                AlpacaModel.sixNDFModel.append(supportNode)
                supportNode.setNodeTag(AlpacaModel)
        
        
        AlpacaModel.supports.append(supportNode)
        AlpacaModel.py.append(supportNode.write_tcl())
    
    
    end = time.clock() - start
    print("time to create support and assign tag {}".format(end))
    start = time.clock()
    
    
    ####################
    # create constraints
    ####################
    
    
    for constraint in Constraint:
        constraint.setNodeTag(AlpacaModel)
        AlpacaModel.constraints.append(constraint)
    
    ####################
    # create equalDOF when the model has 3df and 6df together
    ####################
    
    
    end = time.clock() - start
    print("time to create constraint and assign tag {}".format(end))
    start = time.clock()
    
    
    Id = []
    IdB = []
    
    def SearchCallback(sender, e):
        Id.Add(e.Id)
        IdB.Add(e.IdB)
    
    
    
    lenThreeNDF = len(AlpacaModel.uniquePointsThreeNDF)
    lenSixNDF = len(AlpacaModel.uniquePointsSixNDF)
    
    
    if not(lenThreeNDF == 0 or lenSixNDF == 0):
        print("brick and beam together")
        rg.RTree.SearchOverlaps(AlpacaModel.RTreeCloudPointThreeNDF, AlpacaModel.RTreeCloudPointSixNDF, 0.001, SearchCallback)
        
        for i,j in zip(Id, IdB):
            print(i,j)
            node_i = AlpacaModel.uniquePointsThreeNDF[i]
            node_j = AlpacaModel.uniquePointsSixNDF[j]
            
            #index_i = AlpacaModel.cloudPoint.ClosestPoint(node_i) + 1
            #index_j = AlpacaModel.cloudPoint.ClosestPoint(node_j) + 1
            
            equalConstraint = alpaca.EqualDOF(node_i, node_j, True, True, True, False, False, False)
            equalConstraint.masterNodeTag = AlpacaModel.cloudPointThreeNDF.ClosestPoint(node_i) + 1
            equalConstraint.slaveNodesTag = AlpacaModel.cloudPointSixNDF.ClosestPoint(node_j) + 1 + len(AlpacaModel.uniquePointsThreeNDF)
            AlpacaModel.py.append(equalConstraint.write_tcl())
    
    
    
    end = time.clock() - start
    print("time to find common points between 3ndf and 6ndf {}".format(end))
    start = time.clock()
    
    
    # write py file
    
    
    # assign tag and node Index to element and shell
    for index, element in enumerate(Element,1):
        element.setTopologyRTree(AlpacaModel)
        element.eleTag = index
        element.setTags()
    
    
    
    end = time.clock() - start
    print("time to assign tags for the elements {}".format(end))
    start = time.clock()
    
    
    
    Mass = 0
    IsGravity = False
    
    for item in Load:
        if item.type == "Gravity Load":
            IsGravity = True
            GravityLoad = item
        if item.type == "PointLoad":
            AlpacaModel.loads.append(item)
    
    
    for item in Element:
        if item.type == "Beam":
            length = item.Crv.GetLength()
            Mass += (item.massDens * length)
            if IsGravity:
                gravityPointLoad = alpaca.PointLoad(item.Crv.PointAtStart, rg.Vector3d(0,0, -(item.massDens * length / 2)) * GravityLoad.GravityFactor, rg.Vector3d(0,0,0), GravityLoad.TimeSeries)
                #print( -(item.massDens * length / 2))
                AlpacaModel.loads.append(gravityPointLoad)
        if item.type == "Shell":
            meshArea = rg.AreaMassProperties.Compute(item.Mesh).Area
            areaDensity = item.CrossSection.height * item.CrossSection.material.rho
            Mass += areaDensity * meshArea
            if IsGravity:
                for vertex in item.Mesh.Vertices.ToPoint3dArray():
                    gravityPointLoad = alpaca.PointLoad(vertex, rg.Vector3d(0,0, -(areaDensity * meshArea/ len(item.Mesh.Vertices))) * GravityLoad.GravityFactor, rg.Vector3d(0,0,0), GravityLoad.TimeSeries)
                    AlpacaModel.loads.append(gravityPointLoad)
        if item.type == "Brick":
            #print(type(item.Mesh))
            meshVolume = rg.VolumeMassProperties.Compute(item.Mesh).Volume
            density = item.material.rho 
            Mass += density * meshVolume
            if IsGravity:
                for vertex in item.Mesh.Vertices.ToPoint3dArray():
                    gravityPointLoad = alpaca.PointLoad(vertex, rg.Vector3d(0,0, -(density * meshVolume / len(item.Mesh.Vertices))) * GravityLoad.GravityFactor, rg.Vector3d(0,0,0), GravityLoad.TimeSeries)
                    #print(len(item.Mesh.Vertices))
                    #print(density)
                    # volume can be zero if mesh faces are not properly rotated
                    #print(meshVolume)
                    #print(-(density * meshVolume / len(item.Mesh.Vertices)))
                    AlpacaModel.loads.append(gravityPointLoad)
    
    #print(AlpacaModel.loads)
    ## load
    
    
    for item in AlpacaModel.loads:
        item.setNodeTag(AlpacaModel)
    
    #print(AlpacaModel.loads)
    
    for item in AlpacaModel.beams:
        AlpacaModel.py.append(item.write_tcl())
    
    for item in AlpacaModel.shells:
        AlpacaModel.py.append(item.write_tcl())
    
    for item in AlpacaModel.bricks:
        AlpacaModel.py.append(item.write_tcl())
    
    
    for item in Constraint:
        AlpacaModel.py.append(item.write_tcl())
    
    
    timeSeriesDict = alpaca.TimeSeries.getTimeSeries(AlpacaModel.loads)[1]
    AlpacaModel.py.append(alpaca.PointLoad.write_tcl(timeSeriesDict,AlpacaModel))
# ---------- end am ----------
vm = ViewModelAlpaca4d(AlpacaModel=am.AlpacaModel, type=Toggle(True), nodeTag=Toggle(True))  # inputs type: Boolean, nodeTag: Boolean, eleTag: Boolean, localAxis: Boolean, support: Boolean, load: Boolean
# ---------- vm: Python ----------
"""View structural Model
    Inputs:
        AlpacaModel: Output of Assemble Model.
        type: Style of visualize Model 
Default: Visualize the stick Model
True: Visualize the extrude Model
        nodeTag: 
True: Visualize tag nodes
        eleTag: 
True: Visualize tag elements 
        LocalAxes:
True: Visualize local Axis of elements 
        Support: 
True: Visualize support type
        Load: 
True: Visualize load
"""


from ghpythonlib.componentbase import executingcomponent as component
import Grasshopper, GhPython
import System
import ghpythonlib.components as ghcomp

import Rhino as rc
import rhinoscriptsyntax as rs
import sys
import Rhino.Geometry as rg
import Grasshopper as gh
import copy

ghenv.Component.Name = "View Model (Alpaca4d)"
ghenv.Component.NickName = 'VM'
ghenv.Component.Message = "View Model (Alpaca4d)"

ghcompfolder = gh.Folders.DefaultAssemblyFolder
if ghcompfolder not in sys.path:
    sys.path.append(ghcompfolder)
try:
    from Alpaca4d import alpaca4dView as alpacaView
except:
    msg = "Cannot import Alpaca4d. Is the Alpaca4d folder available in " + ghcompfolder + "?"
    ghenv.Component.AddRuntimeMessage(gh.Kernel.GH_RuntimeMessageLevel.Error, msg)

checkData = True

class MyComponent(component):
    
    def RunScript(self, AlpacaModel, type, nodeTag, eleTag, localAxis, support, load):
        
        
        self.ModelBeam = []
        self.ModelShell = []
        self.ModelBrick = []
        self.Nodes = []
        self.TagEle = []
        self.localAxis = []
        self.solidSupport = []
        self.viewLoad = []
        
        if not AlpacaModel:
            checkData = False
            msg = "Input parameter AlpacaModel failed to collect data"
            ghenv.Component.AddRuntimeMessage(gh.Kernel.GH_RuntimeMessageLevel.Warning, msg)
        else:
            self.type = type
            
            ## add alpaca install directory to system path
            
            self.ModelBeam = alpacaView.ViewBeam( AlpacaModel, type)
            self.ModelShell = alpacaView.ViewShell( AlpacaModel, type )
            self.ModelBrick = alpacaView.ViewBrick( AlpacaModel)
            #NODE TAG VIEW
            if nodeTag is True:
                self.Nodes = [ [inode.nodeTag, inode.Pos] for inode in AlpacaModel.nodes]
            else:
                self.Nodes = []
            #ELE TAG VIEW
            if eleTag is True:
                TagBeam = [ [item.eleTag, item.getPerpFrame().Origin] for item in AlpacaModel.beams]
                TagShell = [ [item.eleTag, rg.AreaMassProperties.Compute( item.Mesh, False, True, False, False ).Centroid] for item in AlpacaModel.shells]
                TagBrick = [ [item.eleTag, rg.AreaMassProperties.Compute( item.Mesh, False, True, False, False ).Centroid] for item in AlpacaModel.bricks]
                self.TagEle = TagBeam + TagShell + TagBrick
            else:
                self.TagEle = []
            #LOCAL AXIS
            if localAxis is True:
                self.localAxis = [ item.getPerpFrame() for item in AlpacaModel.beams]
            else:
                self.localAxis = []
            #SUPPORT
            if support is True:
                scale = 0.5
                self.solidSupport = [ alpacaView.Support( iSupport, scale ) for iSupport in AlpacaModel.supports ]
            else:
                self.solidSupport = []
            # LOAD
            if load is True:
                self.viewLoad =[[item.Pos, item.Force, item.Moment] for item in AlpacaModel.loads]
            else:
                self.viewLoad = []
            self.forceBounds = ghcomp.Bounds([ item[1] for item in self.viewLoad])
            self.momentBounds = ghcomp.Bounds([ item[2] for item in self.viewLoad])

    def DrawViewportWires(self,arg):
        # Beam
        for iBeam in self.ModelBeam:
            color = iBeam[1]
            colorMaterial = rc.Display.DisplayMaterial(color, 0.3)
            if self.type is True:
                colorWirframe = System.Drawing.Color.Gray
                #System.Drawing.Color.LightGray
                arg.Display.DrawBrepShaded(iBeam[0], colorMaterial)
                arg.Display.DrawBrepWires(iBeam[0], colorWirframe)
            else :
                thickness =2
                arg.Display.DrawCurve(iBeam[0], color, thickness)
        # Mesh
        for iShell in self.ModelShell:
            color = iShell[1]
            #color = System.Drawing.Color.Blue
            colorMaterial = rc.Display.DisplayMaterial(color,color,color,color,1,0.30)
            colorMaterial.IsTwoSided = False
            arg.Display.DrawMeshShaded(iShell[0], colorMaterial)
            colorWirframe = System.Drawing.Color.Black
            arg.Display.DrawMeshWires(iShell[0], colorWirframe)
        #Brick 
        for iBrick in self.ModelBrick:
            color = iBrick[1]
            #color = System.Drawing.Color.Blue
            colorMaterial = rc.Display.DisplayMaterial(color,color,color,color,1,0.30)
            colorMaterial.IsTwoSided = False
            arg.Display.DrawMeshShaded(iBrick[0], colorMaterial)
            colorWirframe = System.Drawing.Color.Black
            arg.Display.DrawMeshWires(iBrick[0], colorWirframe)
            
        # node Tag view
        for inode in self.Nodes:
            arg.Display.Draw2dText( str(inode[0]), System.Drawing.Color.DarkSlateBlue, inode[1], True, 50)
        # ele Tag view
        for iEle in self.TagEle:
            arg.Display.Draw2dText( str(iEle[0]), System.Drawing.Color.BlanchedAlmond, iEle[1], True, 50)
        # local Axis
        for iLocalAxis in self.localAxis:
            arg.Display.DrawArrow( rg.Line(iLocalAxis.Origin, iLocalAxis.XAxis), System.Drawing.Color.Red)
            arg.Display.DrawArrow( rg.Line(iLocalAxis.Origin, iLocalAxis.YAxis), System.Drawing.Color.Green)
            arg.Display.DrawArrow( rg.Line(iLocalAxis.Origin, iLocalAxis.ZAxis), System.Drawing.Color.Blue)
            
        color = System.Drawing.Color.Azure
        colorWirframe = System.Drawing.Color.Black
        colorMaterial = rc.Display.DisplayMaterial(color, 0.0)
        for iSupport in self.solidSupport :
            arg.Display.DrawBrepShaded( iSupport, colorMaterial)
            arg.Display.DrawBrepWires( iSupport, colorWirframe)
            
        for iLoad in self.viewLoad:
            arg.Display.DrawArrow( rg.Line(iLoad[0], iLoad[1]/self.forceBounds[1]) ,  System.Drawing.Color.DarkRed)
            arg.Display.DrawArrow( rg.Line(iLoad[0], iLoad[2]/self.momentBounds[1]) ,  System.Drawing.Color.DarkBlue)
# ---------- end vm ----------
ra = RunAnalysisAlpaca4d(AlpacaModel=am.AlpacaModel, Settings=as.Analysis)  # -> log, AlpacaSolvedModel
# ---------- ra: Python ----------
"""
Run an OpenSees Analysis
-
    Args:
        AlpacaModel:
        Settings:
    Returns:
        AlpacaSolvedModel:
"""



import Rhino.RhinoDoc
import Grasshopper as gh
import copy
import rhinoscriptsyntax as rs
import os
import time
import sys



ghenv.Component.Name = "Run Analysis (Alpaca4d)"
ghenv.Component.NickName = 'RA'
ghenv.Component.Message = "Run Analysis (Alpaca4d)"

ghcompfolder = gh.Folders.DefaultAssemblyFolder
if ghcompfolder not in sys.path:
    sys.path.append(ghcompfolder)

try:
    from Alpaca4d import alpaca4d as alpaca
except:
    msg = "Cannot import Alpaca4d. Is the Alpaca4d folder available in " + ghcompfolder + "?"
    ghenv.Component.AddRuntimeMessage(gh.Kernel.GH_RuntimeMessageLevel.Error, msg)


checkData = True



if not AlpacaModel:
    checkData = False
    msg = "Input parameter AlpacaModel failed to collect data"
    ghenv.Component.AddRuntimeMessage(gh.Kernel.GH_RuntimeMessageLevel.Warning, msg)


if not Settings:
    checkData = False
    msg = "Input parameter Settings failed to collect data"
    ghenv.Component.AddRuntimeMessage(gh.Kernel.GH_RuntimeMessageLevel.Warning, msg)


if checkData:
    FolderPath = rs.DocumentPath()
    os.chdir(FolderPath)
    
    outputFileName = 'openSeesModel'
    recorderFileName = 'recorder.mpco'
    
    for dirpath, dirnames, filenames in os.walk(FolderPath):
        for filename in filenames:
            if filename == outputFileName:
                file = os.path.join(dirpath,outputFileName)
                os.remove(file)
            elif filename == recorderFileName:
                file = os.path.join(dirpath,recorderFileName)
                os.remove(file)
    
    
    # create a copy
    
    AnalysisModel = copy.copy(AlpacaModel)
    AnalysisModel.py = list(AnalysisModel.py)
    
    # generate Recorder and assign name
    AnalysisModel.recorderName = "recorder" + ".mpco"
    
    AnalysisModel.py.append(alpaca.TCLRecorder.mpco(AnalysisModel.recorderName, True,True,True,True,False,False,True,True,True,True))
    
    
    AnalysisModel.analysis = Settings
    AnalysisModel.py.append(Settings.write_tcl())
    AnalysisModel.py.append("wipe")
    
    
    #textFile = AnalysisModel.py
    
    time_start = time.clock()
    
    AnalysisModel.writeFile(outputFileName)
    
    time_elapsed = (time.clock() - time_start)
    print("Writing Time {}".format(time_elapsed))
    
    
    
    time_start = time.clock()
    
    executable = os.path.join(ghcompfolder,'Alpaca4d\OpenSees-Solvers\opensees.bat')
    a, log = AnalysisModel.runOpensees(executable)
    
    
    time_elapsed = (time.clock() - time_start)
    print("Analyses Time {}".format(time_elapsed))
    
    AlpacaSolvedModel = copy.copy(AnalysisModel)
    AlpacaSolvedModel.isAnalysed = True
# ---------- end ra ----------
panel_5 = Panel(ra.log)
ds = DisassembleModelAlpaca4d(AlpacaModel=ra.AlpacaSolvedModel)  # -> out, Points, threeNdfPoints, sixNdfPoints, Beam, Shell, Brick, Support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
# ---------- ds: Python ----------
"""
Disassemble a Model
-
    Args:
        AlpacaModel:
    Returns:
        Points:
        threeNdfPoints:
        sixNdfPoints:
        
        Beam:
        Shell:
        Brick:
        Support:
        Constraint:
        TimeSeries:
        Load:
        Material:
"""

ghenv.Component.Name = "Disassemble Model (Alpaca4d)"
ghenv.Component.NickName = 'DS'
ghenv.Component.Message = "Disassemble Model (Alpaca4d)"


import sys
import Rhino.Geometry as rg
import Grasshopper as gh


## add alpaca install directory to system path

ghcompfolder = gh.Folders.DefaultAssemblyFolder
if ghcompfolder not in sys.path:
    sys.path.append(ghcompfolder)

try:
    from Alpaca4d import alpaca4d as alpaca
except:
    msg = "Cannot import Alpaca4d. Is the Alpaca4d folder available in " + ghcompfolder + "?"
    ghenv.Component.AddRuntimeMessage(gh.Kernel.GH_RuntimeMessageLevel.Error, msg)

checkData = True


if not AlpacaModel:
    checkData = False
    msg = "Input parameter AlpacaModel failed to collect data"
    ghenv.Component.AddRuntimeMessage(gh.Kernel.GH_RuntimeMessageLevel.Warning, msg)

if checkData:
    Points = AlpacaModel.uniquePoints
    threeNdfPoints = AlpacaModel.uniquePointsThreeNDF
    sixNdfPoints = AlpacaModel.uniquePointsSixNDF
    
    Beam = AlpacaModel.beams
    Shell  = AlpacaModel.shells
    Brick = AlpacaModel.bricks
    Support = AlpacaModel.supports
    Constraint = AlpacaModel.constraints
    TimeSeries = AlpacaModel.timeSeries
    Load = AlpacaModel.loads
    Material = AlpacaModel.materials
# ---------- end ds ----------
nd = NodalDisplacementsAlpaca4d(AlpacaModel=ra.AlpacaSolvedModel)  # -> out, displacement, rotation; inputs History: Boolean, step: Int32
# ---------- nd: Python ----------
"""
Read displacement results
-
    Args:
        AlpacaModel:
        History: True to visualise the displacement and rotation history of the points
        step:
    Returns:
        displacement:
        rotation:
        displacement_History:
        rotation_History:
"""

ghenv.Component.Name = "Nodal Displacements (Alpaca4d)"
ghenv.Component.NickName = 'ND'
ghenv.Component.Message = "Displacements (Alpaca4d)"

import sys
import os
import System
from System.Drawing import Color


import clr
import clrtype
import Rhino.Geometry as rg
import rhinoscriptsyntax as rs
import Grasshopper as gh
import copy
import ghpythonlib.treehelpers as th



## add alpaca install directory to system path

ghcompfolder = gh.Folders.DefaultAssemblyFolder
if ghcompfolder not in sys.path:
    sys.path.append(ghcompfolder)

try:
    from Alpaca4d import alpaca4d as alpaca
except:
    msg = "Cannot import Alpaca4d. Is the Alpaca4d folder available in " + ghcompfolder + "?"
    ghenv.Component.AddRuntimeMessage(gh.Kernel.GH_RuntimeMessageLevel.Error, msg)



FolderPath = rs.DocumentPath()
os.chdir(FolderPath)

my_module_name = "Alpaca_StepReader" # replace this with something unique that doesn't collide with a real module!
my_module = sys.modules.setdefault(my_module_name, type(sys)(my_module_name))

hdfFilePath = os.path.join(ghcompfolder, "Alpaca4d\HDF5CSharp.dll")
clr.AddReferenceToFileAndPath(hdfFilePath)


from HDF5CSharp import Hdf5

try:
    Steps = my_module.Steps
except AttributeError:
    type_2d = type(System.Array.CreateInstance(float, 1, 1))

    class Steps(object):
        __metaclass__ = clrtype.ClrClass
        _clrfields = {"STEP_{}".format(i): type_2d for i in range(1000)} # it will work for model with less than 1000 steps

    my_module.Steps = Steps



checkData = True

if not AlpacaModel:
    checkData = False
    msg = "Input parameter AlpacaModel failed to collect data"
    ghenv.Component.AddRuntimeMessage(gh.Kernel.GH_RuntimeMessageLevel.Warning, msg)



History = False if History is None else History


if checkData:
    step = (int(AlpacaModel.analysis.NumberOfSteps) - 1) if step is None else step
    numberOfPoints = len(AlpacaModel.uniquePoints) #
    
    if not History:
        try:
            fileId = Hdf5.OpenFile(AlpacaModel.recorderName, True)
            
            
            displacementResult = Hdf5.ReadObject[Steps](fileId, "/MODEL_STAGE[1]/RESULTS/ON_NODES/DISPLACEMENT/DATA")
            displacement = []
            for i in range(numberOfPoints):
                x = getattr(displacementResult, 'STEP_{}'.format(step))[i,0]
                y = getattr(displacementResult, 'STEP_{}'.format(step))[i,1]
                z = getattr(displacementResult, 'STEP_{}'.format(step))[i,2]
                displacement.append(rg.Vector3d(x,y,z))
            
            
            rotationResult = Hdf5.ReadObject[Steps](fileId, "/MODEL_STAGE[1]/RESULTS/ON_NODES/ROTATION/DATA")
            rotation = []
            for i in range(numberOfPoints):
                x = getattr(rotationResult, 'STEP_{}'.format(step))[i,0]
                y = getattr(rotationResult, 'STEP_{}'.format(step))[i,1]
                z = getattr(rotationResult, 'STEP_{}'.format(step))[i,2]
                rotation.append(rg.Vector3d(x,y,z))
                
                
            Hdf5.CloseFile(fileId)
            print("I have closed the file")
        except:
            if fileId >0:
                Hdf5.CloseFile(fileId)
                print("I have closed the file because of exception")
    
    
    
    if History:
        try:
            fileId = Hdf5.OpenFile(AlpacaModel.recorderName, True)
            
            displacementResult = Hdf5.ReadObject[Steps](fileId, "/MODEL_STAGE[1]/RESULTS/ON_NODES/DISPLACEMENT/DATA")
            displacement = []
            
            for i in range(numberOfPoints):
                dispTemp = []
                maxNumberStep = int(AlpacaModel.analysis.NumberOfSteps)
                for n_step in range(maxNumberStep):
                    x = getattr(displacementResult, 'STEP_{}'.format(n_step))[i,0]
                    y = getattr(displacementResult, 'STEP_{}'.format(n_step))[i,1]
                    z = getattr(displacementResult, 'STEP_{}'.format(n_step))[i,2]
                    dispTemp.append(rg.Vector3d(x,y,z))
                    
                
                displacement.append(dispTemp)
    
    
    
    
            rotationResult = Hdf5.ReadObject[Steps](fileId, "/MODEL_STAGE[1]/RESULTS/ON_NODES/ROTATION/DATA")
            
            rotation = []
            
            for i in range(numberOfPoints):
                rotationTemp = []
                for n_step in range(maxNumberStep):
                    x = getattr(rotationResult, 'STEP_{}'.format(n_step))[i,0]
                    y = getattr(rotationResult, 'STEP_{}'.format(n_step))[i,1]
                    z = getattr(rotationResult, 'STEP_{}'.format(n_step))[i,2]
                    rotationTemp.append(rg.Vector3d(x,y,z))
                
                rotation.append(rotationTemp)
                
            Hdf5.CloseFile(fileId)
        except:
            Hdf5.CloseFile(fileId)
    
    
    displacement = th.list_to_tree(displacement)
    rotation = th.list_to_tree(rotation)
# ---------- end nd ----------
multiplication_5 = Multiplication(A=nd.displacement, B=Slider(408, range=1..1000))
dm = DeformedModelAlpaca4d(
    AlpacaSolvedModel=ra.AlpacaSolvedModel,
    step=Slider(0, range=0..10),
    scale=num,
    extrudeModel=Toggle(True),
    typeColor=Slider(3, range=-4..10))  # -> DefModel, bounds; inputs step: Int32, extrudeModel: Boolean, typeColor: Int32, listColor: list of Color
# ---------- dm: Python ----------
"""View Deformed model
    Args:
        AlpacaSolvedModel: Output of Analyses solver
        step:
        scale: Multiplication factor for displacement
        extrudeModel:  
True : view extruded model
else : view stick model
        typeColor:  View relative color of the traslation
<=0 : view traslation X 
1 : view traslation Y
2 : view traslation Z
>= 3 : view resulting displacement.
        listColor : one list of color 

    Output:
       DefModel: view deformed model
       bounds: max end min of displacement of the structure 
"""

ghenv.Component.Name = "Deformed Model (Alpaca4d)"
ghenv.Component.NickName = 'DM'
ghenv.Component.Message = "Deformed Model (Alpaca4d)"

from ghpythonlib.componentbase import executingcomponent as component
import System
import rhinoscriptsyntax as rs

import sys
import os
import clr
import clrtype
import Rhino.Geometry as rg
import Rhino as rc
import math as mt
import Grasshopper as gh
import ghpythonlib.treehelpers as th
from ghpythonlib.components import ConstructDomain

ghcompfolder = gh.Folders.DefaultAssemblyFolder
if ghcompfolder not in sys.path:
    sys.path.append(ghcompfolder)
try:
    from Alpaca4d import alpaca4dView as alpacaView
except:
    msg = "Cannot import Alpaca4d. Is the Alpaca4d folder available in " + ghcompfolder + "?"
    ghenv.Component.AddRuntimeMessage(gh.Kernel.GH_RuntimeMessageLevel.Error, msg)
    
FolderPath = rs.DocumentPath()
os.chdir(FolderPath)

ghcompfolder = gh.Folders.DefaultAssemblyFolder
my_module_name = "Alpaca_StepReader" # replace this with something unique that doesn't collide with a real module!
my_module = sys.modules.setdefault(my_module_name, type(sys)(my_module_name))

hdfFilePath = os.path.join(ghcompfolder, "Alpaca4d\HDF5CSharp.dll")
clr.AddReferenceToFileAndPath(hdfFilePath)


from HDF5CSharp import Hdf5

class MyComponent(component):
    
    def RunScript(self, AlpacaSolvedModel, step = None, scale = None , extrudeModel = None, typeColor = None, listColor = [] ):
        import sys
        
        self.extrudeModel = extrudeModel
        
        self.defModel1 = []
        self.defModel2 = []
        self.defModel3 = []
        
        self.beamColor = []
        

        if step == None:
            step = 0
        if scale == None:
            scale = 1
        if extrudeModel == None:
            extrudeModel = False
        if typeColor == None:
            typeColor = 3
        
        if not listColor: listColor = [ System.Drawing.Color.DarkViolet, 
                                        System.Drawing.Color.BlueViolet, 
                                        System.Drawing.Color.RoyalBlue, 
                                        System.Drawing.Color.CornflowerBlue,
                                        System.Drawing.Color.LightSkyBlue, 
                                        System.Drawing.Color.LightBlue,
                                        System.Drawing.Color.CadetBlue,
                                        System.Drawing.Color.LightGreen,
                                        System.Drawing.Color.GreenYellow,
                                        System.Drawing.Color.Yellow,
                                        System.Drawing.Color.Orange,
                                        System.Drawing.Color.Red,
                                        System.Drawing.Color.DarkRed]
        
        
        ghcompfolder = gh.Folders.DefaultAssemblyFolder
        if ghcompfolder not in sys.path:
            sys.path.append(ghcompfolder)
    
        try:
            Steps = my_module.Steps
        except AttributeError:
            type_2d = type(System.Array.CreateInstance(float, 1, 1))
                
            class Steps(object):
                __metaclass__ = clrtype.ClrClass
                _clrfields = {"STEP_{}".format(i): type_2d for i in range(1000)} # it will work for model with less than 1000 steps
                
            my_module.Steps = Steps
            
        checkData = True
        
        if not AlpacaSolvedModel:
            checkData = False
            msg = "Input parameter AlpacaSolvedModel failed to collect data"
            ghenv.Component.AddRuntimeMessage(gh.Kernel.GH_RuntimeMessageLevel.Warning, msg)
        else:
            try:
                fileId = Hdf5.OpenFile(AlpacaSolvedModel.recorderName, True)
                numberOfPoints = len(AlpacaSolvedModel.uniquePoints) #
                        
                        
                displacementResult = Hdf5.ReadObject[Steps](fileId, "/MODEL_STAGE[1]/RESULTS/ON_NODES/DISPLACEMENT/DATA")
                displacement = []
                rotation = []
                dispNodeList = []
                for i in range(numberOfPoints):
                    tag = i + 1
                    vx = getattr(displacementResult, 'STEP_{}'.format(step))[i,0]
                    vy = getattr(displacementResult, 'STEP_{}'.format(step))[i,1]
                    vz = getattr(displacementResult, 'STEP_{}'.format(step))[i,2]
                    trasl = rg.Vector3d(vx,vy,vz)
                    displacement.append(trasl)
                    dispNodeList.append( [tag, trasl] )
                    
                Hdf5.CloseFile(fileId)
                print("I have closed the file")
            
                dispNodeDict = dict( dispNodeList )
                #---------------------------------------------------#
                defEleVector1 = alpacaView.BeamVectorDef(AlpacaSolvedModel,dispNodeDict) #beam
                defEleVector2 = alpacaView.ShellVectorDef(AlpacaSolvedModel,dispNodeDict) #shell
                defEleVector3 = alpacaView.BrickVectorDef(AlpacaSolvedModel,dispNodeDict) #shell
                bound = alpacaView.boundsDef(displacement, typeColor)
                if self.extrudeModel == None or self.extrudeModel == False:
                    #BEAM
                    defModel1 = alpacaView.BeamDef(AlpacaSolvedModel, dispNodeDict,scale)
                    self.defModel1, self.beamColor = alpacaView.ColorBeamDef( defModel1, defEleVector1, bound, listColor, typeColor)
                    #SHELL
                    defModel2 = alpacaView.ShellDef(AlpacaSolvedModel,dispNodeDict,scale)
                    #BRICK
                    defModel3 = alpacaView.BrickDef(AlpacaSolvedModel,dispNodeDict,scale)
                else:
                    #BEAM
                    defModel1 = alpacaView.BeamDefExtrude(AlpacaSolvedModel, dispNodeDict,scale)
                    self.defModel1 = alpacaView.ColorBeamDefExtrude( defModel1, defEleVector1, bound, listColor, typeColor)
                    #SHELL
                    defModel2 = alpacaView.ShellDefExtrude(AlpacaSolvedModel,dispNodeDict,scale)
                    #BRICK
                    defModel3 = alpacaView.BrickDef(AlpacaSolvedModel,dispNodeDict,scale)
                    
                #SHELL COLOR
                self.defModel2 = alpacaView.ColorShellDef( defModel2, defEleVector2 , bound, listColor, typeColor, extrudeModel )
                #BRICK COLOR
                self.defModel3 = alpacaView.ColorBrickDef( defModel3, defEleVector3 , bound, listColor, typeColor)
                DefModel = th.list_to_tree(self.defModel1 + defModel2 + defModel3)
                bounds = ConstructDomain(bound[0], bound[1])
                return (DefModel, bounds)
            except:
                Hdf5.CloseFile(fileId)
                print("I have closed the file due to exception")
            # return outputs if you have them; here I try it for you:
        
        
    def DrawViewportWires(self,arg):
        for iMesh in self.defModel2 :
            colorWirframe = System.Drawing.Color.Black
            arg.Display.DrawMeshWires(iMesh, colorWirframe)
            
        for iMesh in self.defModel3 :
            colorWirframe = System.Drawing.Color.Black
            arg.Display.DrawMeshWires(iMesh, colorWirframe)
        if self.extrudeModel is None or self.extrudeModel is False:
            thickness =2
            for iBeam, iColor in zip(self.defModel1, self.beamColor) :
                for jBeam, jColor in zip(iBeam, iColor):
                    arg.Display.DrawCurve(jBeam, jColor, thickness)
        else:
            for iBeam in self.defModel1 :
                colorWirframe = System.Drawing.Color.Black
                arg.Display.DrawMeshWires(iBeam, colorWirframe)
# ---------- end dm ----------
move_2 = Move(Geometry=ds.Points, Motion=multiplication_5)  # -> Geometry, Transform
abs_2 = Absolute(Value=dm.bounds)
dedomain_3 = DeconstructDomain(Domain=abs_2)  # -> Start, End
max = Maximum(A=dedomain_3.Start, B=dedomain_3.End)
subtraction = Subtraction(A=max, B=division_4)
abs_3 = Absolute(Value=subtraction)

# ==== cluster Cluster
T = ClusterInput()
i = ClusterInput()
graft = GraftTree(Tree=T, IncludeEmptyLists=True, IncludeNullItems=True)
nv = NakedVertices(Mesh=graft)  # -> ClothedIndex, NakedIndex, ClothedPts, NakedPts
bang = ExplodeTree(Data=nv.NakedPts)
data = Data(nv.NakedPts)
fcircle = CircleFit(Points=bang)  # -> Circle, Radius, Deviation
alongcrv = SortAlongCurve(Points=bang, Curve=fcircle.Circle)  # -> Points, Indices
item = ListItem(List=data, Index=alongcrv.Indices, Wrap=True)
item_2 = ListItem(List=item, Index=i, Wrap=True)  # -> flatten(Item), flatten(Item1)
cull_i = CullIndex(List=item_2.Item, Indices="-1", Wrap=True)
cull_i_2 = CullIndex(List=item_2.Item1, Indices="-1", Wrap=True)
cull_i_3 = CullIndex(List=item_2.Item1, Indices="0", Wrap=True)
cull_i_4 = CullIndex(List=item_2.Item, Indices="0", Wrap=True)
ln = Line(StartPoint=cull_i, EndPoint=cull_i_3)
ln_2 = Line(StartPoint=cull_i_2, EndPoint=cull_i_4)
entwine = Entwine(Branch00=ln, Branch01=ln_2, FlattenInputs=True)
R = ClusterOutput(entwine)
