# Grasshopper definition TetraedronTension_Test.gh (Grasshopper 1.0.7)
# plug-ins: TetgenGH, Kangaroo2 Components

# Closed mesh
mesh = Mesh(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)
tetgen = Tetrahedralize(Mesh=mesh, Flags="0", MinRatio=2)  # -> Mesh, Indices, Points
demesh = DeconstructMesh(Mesh=tetgen.Mesh)  # -> Vertices, Faces, Colours, Normals
shift = ShiftList(List=demesh.Vertices, Shift=1, Wrap=True)
conmesh = ConstructMesh(Vertices=shift, Faces=demesh.Faces)  # -> flatten(Mesh)
demesh_2 = DeconstructMesh(Mesh=tetgen.Mesh)  # -> flatten(Vertices), Faces, Colours, Normals
duppt = RemoveDuplicatePts(Points=demesh_2.Vertices, Tolerance=0.01)
pdecon = Deconstruct(Point=duppt)  # -> XComponent, YComponent, ZComponent
smaller = SmallerThan(FirstNumber=pdecon.ZComponent, SecondNumber="0.1")  # -> SmallerThan, OrEqualTo
larger = LargerThan(FirstNumber=pdecon.ZComponent, SecondNumber="5")  # -> LargerThan, OrEqualTo
eim = ElasticIsotropicMaterialAlpaca4d(name="Bho", E="30000", G="30000", v="0.3", rho="20")  # -> out, nDMaterial
# ---------- eim: Python ----------
"""
Create a nD Elastic Isotropic Material
-
    Args:
        name:
        E:
        G:
        v:
        rho:
    Returns:
        nDMaterial:
"""

ghenv.Component.Name = "Elastic Isotropic Material (Alpaca4d)"
ghenv.Component.NickName = 'EIM'
ghenv.Component.Message = "Elastic Isotropic (Alpaca4d)"


import sys
import Rhino.Geometry as rg
import Grasshopper as gh
import copy


## add alpaca install directory to system path

ghcompfolder = gh.Folders.DefaultAssemblyFolder
if ghcompfolder not in sys.path:
    sys.path.append(ghcompfolder)

try:
    from Alpaca4d import alpaca4d as alpaca
except:
    msg = "Cannot import Alpaca4d. Is the Alpaca4d folder available in " + ghcompfolder + "?"
    ghenv.Component.AddRuntimeMessage(gh.Kernel.GH_RuntimeMessageLevel.Error, msg)


checkData = True

if not E:
    checkData = False
    msg = "Input parameter E failed to collect data"
    ghenv.Component.AddRuntimeMessage(gh.Kernel.GH_RuntimeMessageLevel.Warning, msg)

if not G and not v:
    checkData = False
    msg = "Input parameter G or v failed to collect data"
    ghenv.Component.AddRuntimeMessage(gh.Kernel.GH_RuntimeMessageLevel.Warning, msg)

if not rho:
    checkData = False
    msg = "Input parameter rho failed to collect data"
    ghenv.Component.AddRuntimeMessage(gh.Kernel.GH_RuntimeMessageLevel.Warning, msg)

if checkData:
    nDMaterial = alpaca.ElasticIsotropic(name, E, G, rho, v)
# ---------- end eim ----------
cull = CullPattern(List=duppt, CullPattern=smaller.SmallerThan)
cull_2 = CullPattern(List=duppt, CullPattern=larger.LargerThan)
fnt = FourNodeTetrahedronAlpaca4d(Tetrahedron=tetgen.Mesh, nDMaterial=eim.nDMaterial, Colour=ColourSwatch(SwatchColor=RGB(255, 255, 255)))  # -> out, Element; inputs Tetrahedron: Mesh, Colour: Color
# ---------- fnt: Python ----------
"""
Create a Four Node Tetrahedron Element
-
    Args:
        Tetrahedron:
        nDMaterial:
        Colour:
    Returns:
        Element:
"""

ghenv.Component.Name = "Four Node Tetrahedron (Alpaca4d)"
ghenv.Component.NickName = 'FNT'
ghenv.Component.Message = "Tetrahedron (Alpaca4d)"


import sys
import Rhino.Geometry as rg
import Grasshopper as gh
import copy
from System.Drawing import Color


## add alpaca install directory to system path

ghcompfolder = gh.Folders.DefaultAssemblyFolder
if ghcompfolder not in sys.path:
    sys.path.append(ghcompfolder)

try:
    from Alpaca4d import alpaca4d as alpaca
    from Alpaca4d import alpaca4dUtil as alpacaUtil
except:
    msg = "Cannot import Alpaca4d. Is the Alpaca4d folder available in " + ghcompfolder + "?"
    ghenv.Component.AddRuntimeMessage(gh.Kernel.GH_RuntimeMessageLevel.Error, msg)


checkData = True

if not Tetrahedron:
    checkData = False
    msg = "Input parameter Tetrahedron failed to collect data"
    ghenv.Component.AddRuntimeMessage(gh.Kernel.GH_RuntimeMessageLevel.Warning, msg)

if not nDMaterial:
    checkData = False
    msg = "Input parameter nDMaterial failed to collect data"
    ghenv.Component.AddRuntimeMessage(gh.Kernel.GH_RuntimeMessageLevel.Warning, msg)

if not Colour:
    Colour = Color.PaleGoldenrod

if checkData:
    Tetrahedron = alpacaUtil.cleanTetrahedron(Tetrahedron)
    Element = alpaca.FourNodeTetrahedron(Tetrahedron,copy.deepcopy(nDMaterial), Colour)
# ---------- end fnt ----------
data = Data(cull)
data_2 = Data(cull_2)
toggle = BooleanToggle(True)
cts = ConstantTimeSeriesAlpaca4d(constantFactor="1")  # -> TimeSeries, Graph
# ---------- cts: Python ----------
"""
Create a Constant Time Series
-
    Args:
        tStart:
        tEnd:
        period:
        factor:
        shift:
    Returns:
        TimeSeries:
        Graph:
"""

ghenv.Component.Name = "Constant Time Series (Alpaca4d)"
ghenv.Component.NickName = 'CTS'
ghenv.Component.Message = "Constant Time Series (Alpaca4d)"


import sys
import Rhino.Geometry as rg
import Grasshopper as gh
import copy
import math


## add alpaca install directory to system path

ghcompfolder = gh.Folders.DefaultAssemblyFolder
if ghcompfolder not in sys.path:
    sys.path.append(ghcompfolder)

try:
    from Alpaca4d import alpaca4d as alpaca
except:
    msg = "Cannot import Alpaca4d. Is the Alpaca4d folder available in " + ghcompfolder + "?"
    ghenv.Component.AddRuntimeMessage(gh.Kernel.GH_RuntimeMessageLevel.Error, msg)

def ConstantSeries(x):
    return x



checkData = True

if not constantFactor:
    constantFactor = 1


if checkData:
    TimeSeries = alpaca.TimeSeriesConstant(constantFactor)
    
    Graph = []
    
    for x in range(10):
        Graph.append(ConstantSeries(constantFactor))
# ---------- end cts ----------
vec = VectorXYZ(XComponent=0, YComponent=0, ZComponent="-30")  # -> Vector, Length
support = SupportAlpaca4d(Pos=data, Tx=toggle, Ty=toggle, Tz=toggle, Rx=toggle, Ry=toggle, Rz=toggle)  # -> Support; inputs Pos: Point3d, Tx: Boolean, Ty: Boolean, Tz: Boolean, Rx: Boolean, Ry: Boolean, Rz: Boolean
# ---------- support: Python ----------
"""
Create a support
-
    Args:
        Pos:
        Tx:
        Ty:
        Tz:
        Rx:
        Ry:
    Returns:
        Support:
"""

ghenv.Component.Name = "Support (Alpaca4d)"
ghenv.Component.NickName = 'Support'
ghenv.Component.Message = "Support (Alpaca4d)"


import sys
import Rhino.Geometry as rg
import Grasshopper as gh


## add alpaca install directory to system path

ghcompfolder = gh.Folders.DefaultAssemblyFolder
if ghcompfolder not in sys.path:
    sys.path.append(ghcompfolder)

try:
    from Alpaca4d import alpaca4d as alpaca
except:
    msg = "Cannot import Alpaca4d. Is the Alpaca4d folder available in " + ghcompfolder + "?"
    ghenv.Component.AddRuntimeMessage(gh.Kernel.GH_RuntimeMessageLevel.Error, msg)

checkData = True


if not Pos:
    checkData = False
    msg = "Input parameter Pos failed to collect data"
    ghenv.Component.AddRuntimeMessage(gh.Kernel.GH_RuntimeMessageLevel.Warning, msg)

if checkData:
    Support = alpaca.Support(Pos, Tx, Ty, Tz, Rx, Ry, Rz)
# ---------- end support ----------
pl = PointLoadAlpaca4d(Pos=data_2, Force=vec.Vector, TimeSeries=cts.TimeSeries)  # -> out, Load; inputs Pos: Point3d, Force: Vector3d, Moment: Vector3d
# ---------- pl: Python ----------
"""
Create a Point Load
-
    Args:
        Pos:
        Force:
        Moment:
        TimeSeries:
    Returns:
        PointLoad:
"""

ghenv.Component.Name = "Point Load (Alpaca4d)"
ghenv.Component.NickName = 'PL'
ghenv.Component.Message = "Point Load (Alpaca4d)"



import sys
import Rhino.Geometry as rg
import Grasshopper as gh
import copy


## add alpaca install directory to system path

ghcompfolder = gh.Folders.DefaultAssemblyFolder
if ghcompfolder not in sys.path:
    sys.path.append(ghcompfolder)

try:
    from Alpaca4d import alpaca4d as alpaca
except:
    msg = "Cannot import Alpaca4d. Is the Alpaca4d folder available in " + ghcompfolder + "?"
    ghenv.Component.AddRuntimeMessage(gh.Kernel.GH_RuntimeMessageLevel.Error, msg)


checkData = True

if not Pos:
    checkData = False
    msg = "Input parameter Pos failed to collect data"
    ghenv.Component.AddRuntimeMessage(gh.Kernel.GH_RuntimeMessageLevel.Warning, msg)

if not Force:
    Force = rg.Vector3d(0,0,0)

if not Moment:
    Moment = rg.Vector3d(0,0,0)

if not TimeSeries:
    checkData = False
    msg = "Input parameter TimeSeries failed to collect data"
    ghenv.Component.AddRuntimeMessage(gh.Kernel.GH_RuntimeMessageLevel.Warning, msg)


if checkData:
    Load = alpaca.PointLoad(Pos, Force, Moment, TimeSeries)
# ---------- end pl ----------
am = AssembleModelAlpaca4d(Element=flatten(fnt.Element), Support=flatten(support), Load=flatten(pl.Load))  # -> out, AlpacaModel, Mass; inputs Element: list, Support: list, Load: list, Constraint: list
# ---------- am: Python ----------
"""
Create a FEA Model
-
    Args:
        Element:
        Support:
        Load:
        Constraint:
    Returns:
        AlpacaModel:
"""

ghenv.Component.Name = "Assemble Model (Alpaca4d)"
ghenv.Component.NickName = 'AM'
ghenv.Component.Message = "Assemble Model (Alpaca4d)"




import os
from Alpaca4d import alpaca4d as alpaca
import ghpythonlib.treehelpers as th
import Rhino.Geometry as rg
import Rhino.Collections as rc
import rhinoscriptsyntax as rs
from collections import defaultdict, OrderedDict
import copy
import time



FolderPath = rs.DocumentPath()
os.chdir(FolderPath)

# create the object model
AlpacaModel = alpaca.Model()


start = time.clock()
#subdivide element per type

for element in Element:
    if element.type == "Beam":
        AlpacaModel.beams.append(element)
    elif element.type == "Shell":
        AlpacaModel.shells.append(element)
    elif element.type == "Brick":
        AlpacaModel.bricks.append(element)

end = time.clock() - start
print("time to subdivide element {}".format(end))
start = time.clock()

# create a list of unique point
# need to add the rigid constraint

AlpacaModel.getuniquePoints(AlpacaModel.beams, AlpacaModel.shells, AlpacaModel.bricks, AlpacaModel.constraints)


end = time.clock() - start
print("time to get uniquepoints {}".format(end))
start = time.clock()


#############
# create node and assign to object
#############

if AlpacaModel.uniquePointsThreeNDF:
    AlpacaModel.py.append(alpaca.Model.write3ndf_tcl())
    for point in AlpacaModel.uniquePointsThreeNDF:
        node = alpaca.Node(point)
        node.ndf = 3
        node.setNodeTag(AlpacaModel)
        AlpacaModel.nodes.append( node )
    
        AlpacaModel.py.append(node.write_tcl())


if AlpacaModel.uniquePointsSixNDF:
    AlpacaModel.py.append(alpaca.Model.write6ndf_tcl())
    for point in AlpacaModel.uniquePointsSixNDF:
        node = alpaca.Node(point)
        node.ndf = 6
        node.setNodeTag(AlpacaModel)
        AlpacaModel.nodes.append( node )
     
        AlpacaModel.py.append(node.write_tcl())



end = time.clock() - start
print("time to create node and assign tag {}".format(end))
start = time.clock()


#################
# create supports
#################

for supportNode in Support:
    
    # if the list is empty, skip this operation
    if AlpacaModel.uniquePointsThreeNDF:
        closestPointInThreeNDF = rc.Point3dList.ClosestPointInList(AlpacaModel.uniquePointsThreeNDF, supportNode.Pos)
        if supportNode.Pos.DistanceTo(closestPointInThreeNDF) < 0.001:
            #print("I am in 3ndf")
            supportNode.ndf = 3
            AlpacaModel.threeNDFModel.append(supportNode)
            supportNode.setNodeTag(AlpacaModel)
    
    if AlpacaModel.uniquePointsSixNDF:
        closestPointInSixNDF = rc.Point3dList.ClosestPointInList(AlpacaModel.uniquePointsSixNDF, supportNode.Pos)
        if supportNode.Pos.DistanceTo(closestPointInSixNDF) < 0.001:
            supportNode.ndf = 6
            AlpacaModel.sixNDFModel.append(supportNode)
            supportNode.setNodeTag(AlpacaModel)
    
    
    AlpacaModel.supports.append(supportNode)
    AlpacaModel.py.append(supportNode.write_tcl())


end = time.clock() - start
print("time to create support and assign tag {}".format(end))
start = time.clock()


####################
# create constraints
####################


for constraint in Constraint:
    constraint.setNodeTag(AlpacaModel)
    AlpacaModel.constraints.append(constraint)

####################
# create equalDOF when the model has 3df and 6df together
####################


end = time.clock() - start
print("time to create constraint and assign tag {}".format(end))
start = time.clock()


Id = []
IdB = []

def SearchCallback(sender, e):
    Id.Add(e.Id)
    IdB.Add(e.IdB)



lenThreeNDF = len(AlpacaModel.uniquePointsThreeNDF)
lenSixNDF = len(AlpacaModel.uniquePointsSixNDF)


if not(lenThreeNDF == 0 or lenSixNDF == 0):
    print("brick and beam together")
    rg.RTree.SearchOverlaps(AlpacaModel.RTreeCloudPointThreeNDF, AlpacaModel.RTreeCloudPointSixNDF, 0.001, SearchCallback)
    
    for i,j in zip(Id, IdB):
        print(i,j)
        node_i = AlpacaModel.uniquePointsThreeNDF[i]
        node_j = AlpacaModel.uniquePointsSixNDF[j]
        
        #index_i = AlpacaModel.cloudPoint.ClosestPoint(node_i) + 1
        #index_j = AlpacaModel.cloudPoint.ClosestPoint(node_j) + 1
        
        equalConstraint = alpaca.EqualDOF(node_i, node_j, True, True, True, False, False, False)
        equalConstraint.masterNodeTag = AlpacaModel.cloudPointThreeNDF.ClosestPoint(node_i) + 1
        equalConstraint.slaveNodesTag = AlpacaModel.cloudPointSixNDF.ClosestPoint(node_j) + 1 + len(AlpacaModel.uniquePointsThreeNDF)
        AlpacaModel.py.append(equalConstraint.write_tcl())



end = time.clock() - start
print("time to find common points between 3ndf and 6ndf {}".format(end))
start = time.clock()


# write py file


# assign tag and node Index to element and shell
for index, element in enumerate(Element,1):
    element.setTopologyRTree(AlpacaModel)
    element.eleTag = index
    element.setTags()



end = time.clock() - start
print("time to assign tags for the elements {}".format(end))
start = time.clock()



Mass = 0
IsGravity = False

for item in Load:
    if item.type == "Gravity Load":
        IsGravity = True
        GravityLoad = item
    if item.type == "PointLoad":
        AlpacaModel.loads.append(item)


for item in Element:
    if item.type == "Beam":
        length = item.Crv.GetLength()
        Mass += (item.massDens * length)
        if IsGravity:
            gravityPointLoad = alpaca.PointLoad(item.Crv.PointAtStart, rg.Vector3d(0,0, -(item.massDens * length / 2)) * GravityLoad.GravityFactor, rg.Vector3d(0,0,0), GravityLoad.TimeSeries)
            #print( -(item.massDens * length / 2))
            AlpacaModel.loads.append(gravityPointLoad)
    if item.type == "Shell":
        meshArea = rg.AreaMassProperties.Compute(item.Mesh).Area
        areaDensity = item.CrossSection.height * item.CrossSection.material.rho
        Mass += areaDensity * meshArea
        if IsGravity:
            for vertex in item.Mesh.Vertices.ToPoint3dArray():
                gravityPointLoad = alpaca.PointLoad(vertex, rg.Vector3d(0,0, -(areaDensity * meshArea/ len(item.Mesh.Vertices))) * GravityLoad.GravityFactor, rg.Vector3d(0,0,0), GravityLoad.TimeSeries)
                AlpacaModel.loads.append(gravityPointLoad)
    if item.type == "Brick":
        #print(type(item.Mesh))
        meshVolume = rg.VolumeMassProperties.Compute(item.Mesh).Volume
        density = item.material.rho 
        Mass += density * meshVolume
        if IsGravity:
            for vertex in item.Mesh.Vertices.ToPoint3dArray():
                gravityPointLoad = alpaca.PointLoad(vertex, rg.Vector3d(0,0, -(density * meshVolume / len(item.Mesh.Vertices))) * GravityLoad.GravityFactor, rg.Vector3d(0,0,0), GravityLoad.TimeSeries)
                #print(len(item.Mesh.Vertices))
                #print(density)
                # volume can be zero if mesh faces are not properly rotated
                #print(meshVolume)
                #print(-(density * meshVolume / len(item.Mesh.Vertices)))
                AlpacaModel.loads.append(gravityPointLoad)

#print(AlpacaModel.loads)
## load

for item in AlpacaModel.loads:
    item.setNodeTag(AlpacaModel)

#print(AlpacaModel.loads)

for item in AlpacaModel.beams:
    AlpacaModel.py.append(item.write_tcl())

for item in AlpacaModel.shells:
    AlpacaModel.py.append(item.write_tcl())

for item in AlpacaModel.bricks:
    AlpacaModel.py.append(item.write_tcl())


for item in Constraint:
    AlpacaModel.py.append(item.write_tcl())


timeSeriesDict = alpaca.TimeSeries.getTimeSeries(AlpacaModel.loads)[1]
AlpacaModel.py.append(alpaca.PointLoad.write_tcl(timeSeriesDict,AlpacaModel))
# ---------- end am ----------
panel = Panel("Linear")
as = AnalysisSettingsAlpaca4d(Constraint="Plain", System="BandGen", AnalysisSteps="3")  # -> out, Settings
# ---------- as: Python ----------
"""
Create Analysis settings
-
    Args:
        Constraint: 'Plain', 'Transformation'. Default is 'Transformation'.
        Numberer: 'RCM', 'AMD', 'Plain'. Default is 'RCM'.
        System: 'BandGen', 'BandSPD', 'ProfileSPD', 'SuperLU', 'UmfPack', 'FullGeneral', 'SparseSYM'. Default is 'BandSPD'.
        Test: Feature not implemented. Please contact alpaca4d@gmail.com 
        Algorithm: 'Linear', 'Newton', 'NewtonLineSearch', 'ModifiedNewton', 'KrylovNewton', 'SecantNewton', 'BFGS', 'Broyden'. Default is 'Linear'.
        Integrator: Default is LoadControl.
        AnalysisType: 'Static', 'Transient'. Default is 'Static'.
        AnalyesSteps:
    Returns:
        Analysis:
"""

import sys
import os


import clr
import clrtype
import Rhino.Geometry as rg
import rhinoscriptsyntax as rs
import Grasshopper as gh
import copy
import ghpythonlib.treehelpers as th


ghenv.Component.Name = "Analysis settings (Alpaca4d)"
ghenv.Component.NickName = 'AS'
ghenv.Component.Message = "Analysis settings \n(Alpaca4d)"



from Alpaca4d import alpaca4d as alpaca

checkData = True


# default Value
Constraint = 'Transformation' if Constraint is None else Constraint
ConstraintList = ['Plain', 'Transformation']

for item in ConstraintList:
    if Constraint.lower() == item.lower():
        print(item)
        Constraint = item


# default Value
Numberer = 'RCM' if Numberer is None else Numberer
NumbererList = ['RCM', 'AMD', 'Plain', 'ParallelPlain', 'ParallelRCM']

for i,item in enumerate(NumbererList):
    if Numberer.lower() == item.lower():
        Numberer = item



# default Value
System = 'BandSPD' if System is None else System
SystemList = ['BandGen', 'BandSPD', 'ProfileSPD', 'SuperLU', 'UmfPack', 'FullGeneral', 'SparseSYM']

for i,item in enumerate(SystemList):
    if System.lower() == item.lower():
        System = item


# default Test
Test = 'NormDispIncr 1.0e-6 12 5' if Test is None else Test




# default Value
Algorithm = 'Linear' if Algorithm is None else Algorithm
AlgorithmList = ['Linear', 'Newton', 'NewtonLineSearch', 'ModifiedNewton', 'KrylovNewton', 'SecantNewton', 'BFGS', 'Broyden']

for i,item in enumerate(AlgorithmList):
    if Algorithm.lower() == item.lower():
        Algorithm = item


# default Value
AnalysisType = 'Static' if AnalysisType is None else AnalysisType
AnalysisTypeList = ['Static', 'Transient']

for item in AnalysisTypeList:
    if AnalysisType.lower() == item.lower():
        AnalysisType = item


## Define Integrator
if AnalysisType == "Static":
    Integrator = "LoadControl 1.0" if Integrator is None else Integrator
elif AnalysisType == "Transien":
    Integrator = "Newmark 0.5 0.25" if Integrator is None else Integrator



if not AnalysisSteps:
    checkData = False
    msg = "Input parameter AnalysisSteps failed to collect data"
    ghenv.Component.AddRuntimeMessage(gh.Kernel.GH_RuntimeMessageLevel.Warning, msg)


if checkData:
    Settings = alpaca.Analysis(Constraint, Numberer,System,Test,Algorithm,Integrator,AnalysisType, AnalysisSteps)
    print(Settings.write_tcl())
# ---------- end as ----------
ra = RunAnalysisAlpaca4d(AlpacaModel=am.AlpacaModel, Settings=as.Settings)  # -> log, AlpacaSolvedModel
# ---------- ra: Python ----------
"""
Run an OpenSees Analysis
-
    Args:
        AlpacaModel:
        Settings:
    Returns:
        AlpacaSolvedModel:
"""



import Rhino.RhinoDoc
import Grasshopper as gh
import copy
import rhinoscriptsyntax as rs
import os
import time
import sys



ghenv.Component.Name = "Run Analysis (Alpaca4d)"
ghenv.Component.NickName = 'RA'
ghenv.Component.Message = "Run Analysis (Alpaca4d)"

ghcompfolder = gh.Folders.DefaultAssemblyFolder
if ghcompfolder not in sys.path:
    sys.path.append(ghcompfolder)

try:
    from Alpaca4d import alpaca4d as alpaca
except:
    msg = "Cannot import Alpaca4d. Is the Alpaca4d folder available in " + ghcompfolder + "?"
    ghenv.Component.AddRuntimeMessage(gh.Kernel.GH_RuntimeMessageLevel.Error, msg)


checkData = True



if not AlpacaModel:
    checkData = False
    msg = "Input parameter AlpacaModel failed to collect data"
    ghenv.Component.AddRuntimeMessage(gh.Kernel.GH_RuntimeMessageLevel.Warning, msg)


if not Settings:
    checkData = False
    msg = "Input parameter Settings failed to collect data"
    ghenv.Component.AddRuntimeMessage(gh.Kernel.GH_RuntimeMessageLevel.Warning, msg)


if checkData:
    FolderPath = rs.DocumentPath()
    os.chdir(FolderPath)
    
    outputFileName = 'openSeesModel'
    recorderFileName = 'recorder.mpco'
    
    for dirpath, dirnames, filenames in os.walk(FolderPath):
        for filename in filenames:
            if filename == outputFileName:
                file = os.path.join(dirpath,outputFileName)
                os.remove(file)
            """
            elif filename == recorderFileName:
                file = os.path.join(dirpath,recorderFileName)
                os.remove(file)
            """
    
    # create a copy
    
    AnalysisModel = copy.copy(AlpacaModel)
    AnalysisModel.py = list(AnalysisModel.py)
    
    # generate Recorder and assign name
    AnalysisModel.recorderName = "recorder" + ".mpco"
    
    AnalysisModel.py.append(alpaca.TCLRecorder.mpco(AnalysisModel.recorderName, True,True,True,True,False,False,True,True,True,True))
    
    
    AnalysisModel.analysis = Settings
    AnalysisModel.py.append(Settings.write_tcl())
    AnalysisModel.py.append("wipe")
    
    
    #textFile = AnalysisModel.py
    
    time_start = time.clock()
    
    AnalysisModel.writeFile(outputFileName)
    
    time_elapsed = (time.clock() - time_start)
    print("Writing Time {}".format(time_elapsed))
    
    
    
    time_start = time.clock()
    
    executable = os.path.join(ghcompfolder,'Alpaca4d\OpenSees-Solvers\opensees.bat')
    a, log = AnalysisModel.runOpensees(executable)
    
    
    time_elapsed = (time.clock() - time_start)
    print("Analyses Time {}".format(time_elapsed))
    
    AlpacaSolvedModel = copy.copy(AnalysisModel)
    AlpacaSolvedModel.isAnalysed = True
# ---------- end ra ----------

bs = BrickStressesAlpaca4d(AlpacaSolvedModel=ra.AlpacaSolvedModel, History=Toggle(False), step=Slider(1, range=0..10))  # -> out, sigma_xx, sigma_yy, sigma_zz, tau_xy, tau_xz, tau_yz, sigma_VM; inputs History: Boolean, step: Int32
# ---------- bs: Python ----------
"""
Read Brick Stresses
-
    Args:
        AlpacaSolvedModel:
        step:
    Returns:
        sigma_xx
        sigma_yy
        sigma_zz
        tau_xy
        tau_xz
        tau_yz
        sigma_VM (Von Mises criterion)
"""

ghenv.Component.Name = "Brick Stresses (Alpaca4d)"
ghenv.Component.NickName = 'BS'
ghenv.Component.Message = "Brick Stresses (Alpaca4d)"

import sys
import os
import System
from System.Drawing import Color


import clr
import clrtype
import Rhino.Geometry as rg
import rhinoscriptsyntax as rs
import Grasshopper as gh
import copy
import ghpythonlib.treehelpers as th
import math as mt

## add alpaca install directory to system path

ghcompfolder = gh.Folders.DefaultAssemblyFolder
if ghcompfolder not in sys.path:
    sys.path.append(ghcompfolder)

try:
    from Alpaca4d import alpaca4d as alpaca
except:
    msg = "Cannot import Alpaca4d. Is the Alpaca4d folder available in " + ghcompfolder + "?"
    ghenv.Component.AddRuntimeMessage(gh.Kernel.GH_RuntimeMessageLevel.Error, msg)



FolderPath = rs.DocumentPath()
os.chdir(FolderPath)


# import costum modules to read the hdf5 file

my_module_name = "Alpaca_StepReader"
my_module = sys.modules.setdefault(my_module_name, type(sys)(my_module_name))

hdfFilePath = os.path.join(ghcompfolder, "Alpaca4d\HDF5CSharp.dll")
clr.AddReferenceToFileAndPath(hdfFilePath)

from HDF5CSharp import Hdf5

try:
    Steps = my_module.Steps
except AttributeError:
    type_2d = type(System.Array.CreateInstance(float, 1, 1))

    class Steps(object):
        __metaclass__ = clrtype.ClrClass
        _clrfields = {"STEP_{}".format(i): type_2d for i in range(1000)} # it will work for model with less than 1000 steps

    my_module.Steps = Steps


checkData = True

if not AlpacaSolvedModel:
    checkData = False
    msg = "Input parameter AlpacaSolvedModel failed to collect data"
    ghenv.Component.AddRuntimeMessage(gh.Kernel.GH_RuntimeMessageLevel.Warning, msg)

History = False if History is None else History

if checkData:
    
    step = (int(AlpacaSolvedModel.analysis.NumberOfSteps) - 1) if step is None else step
# read result
    
    sigma_xx = []
    sigma_yy = []
    sigma_zz = []
    tau_xy = []
    tau_xz = []
    tau_yz = []
    sigma_VM = []
    
    
    ## to fix the issue about index of different type of object
    if History == False:
        try:
            fileId = Hdf5.OpenFile(AlpacaSolvedModel.recorderName, True)
            solidSortedByeleTag = sorted(AlpacaSolvedModel.bricks, key=lambda x: x.eleTag)
            
            solidStandardBrick = []
            solidSSPBrick = []
            solidTetra = []
            
            for item in solidSortedByeleTag:
                if item.elementType == "stdBrick": 
                    solidStandardBrick.append(item)
                elif item.elementType == "SSPbrick":
                    solidSSPBrick.append(item)
                elif item.elementType == "FourNodeTetrahedron":
                    solidTetra.append(item)
            
            solidElements1GP = [solidSSPBrick , solidTetra]
            #BRICK
            stressResultSSPBrick = Hdf5.ReadObject[Steps](fileId, "/MODEL_STAGE[1]/RESULTS/ON_ELEMENTS/stresses/121-UnknownMovableObject[400:0:0]/DATA")
            stressResultStandardBrick = Hdf5.ReadObject[Steps](fileId, "/MODEL_STAGE[1]/RESULTS/ON_ELEMENTS/stresses/56-Brick[401:0:0]/DATA")
            #TETRA
            stressResultFNTetra = Hdf5.ReadObject[Steps](fileId, "/MODEL_STAGE[1]/RESULTS/ON_ELEMENTS/stresses/179-FourNodeTetrahedron[300:0:0]/DATA")
            
            for j,stressResult in enumerate([stressResultSSPBrick, stressResultFNTetra]):
                for i in range(len(solidElements1GP[j])):
                    v0 = getattr(stressResult, 'STEP_{}'.format(step))[i,0] 
                    v1 = getattr(stressResult, 'STEP_{}'.format(step))[i,1]
                    v2 = getattr(stressResult, 'STEP_{}'.format(step))[i,2]
                    print( v0)
                    sigma_xx.append(v0) 
                    sigma_yy.append(v1)
                    sigma_zz.append(v2)
                    
                    v3 = getattr(stressResult, 'STEP_{}'.format(step))[i,3] 
                    v4 = getattr(stressResult, 'STEP_{}'.format(step))[i,4] 
                    v5 = getattr(stressResult, 'STEP_{}'.format(step))[i,5] 
                    tau_xy.append(v3)
                    tau_xz.append(v4)
                    tau_yz.append(v5)
                    
                    v6= mt.sqrt( v0**2 + v1**2 + v2**2  - (v0*v1 + v1*v2 + v2*v1) + 3*(v3**2 + v5**2 + v4**2))
                    sigma_VM.append( v6)
                
            Hdf5.CloseFile(fileId)
            print("I have close the file")
        except:
            Hdf5.CloseFile(fileId)
            print("I have close the file")
    
    
    elif History == True:
        try:
            fileId = Hdf5.OpenFile(AlpacaSolvedModel.recorderName, True)
        
            maxNumberStep = int(AlpacaSolvedModel.analysis.NumberOfSteps)
            solidSortedByeleTag = sorted(AlpacaSolvedModel.bricks, key=lambda x: x.eleTag)
            
            solidStandardBrick = []
            solidSSPBrick = []
            solidTetra = []
            
            for item in solidSortedByeleTag:
                if item.elementType == "stdBrick": 
                    solidStandardBrick.append(item)
                elif item.elementType == "SSPbrick":
                    solidSSPBrick.append(item)
                elif item.elementType == "FourNodeTetrahedron":
                    solidTetra.append(item)
        
            solidElements1GP = [solidSSPBrick , solidTetra]
            
            #BRICK
            stressResultSSPBrick = Hdf5.ReadObject[Steps](fileId, "/MODEL_STAGE[1]/RESULTS/ON_ELEMENTS/stresses/121-UnknownMovableObject[400:0:0]/DATA")
            stressResultStandardBrick = Hdf5.ReadObject[Steps](fileId, "/MODEL_STAGE[1]/RESULTS/ON_ELEMENTS/stresses/56-Brick[401:0:0]/DATA")
            #TETRA
            stressResultFNTetra = Hdf5.ReadObject[Steps](fileId, "/MODEL_STAGE[1]/RESULTS/ON_ELEMENTS/stresses/179-FourNodeTetrahedron[300:0:0]/DATA")
            
            for j,stressResult in enumerate([stressResultSSPBrick, stressResultFNTetra]):
                for i in range(len(solidElements1GP[j])):
                    sigmaTemp_xx = []
                    sigmaTemp_yy = []
                    sigmaTemp_zz = []
                    tauTemp_xy = []
                    tauTemp_xz = []
                    tauTemp_yz = []
                    sigmaTemp_VM = []
                    
                    for n_step in range(maxNumberStep):
                        v0 = getattr(stressResult, 'STEP_{}'.format(step))[i,0] 
                        v1 = getattr(stressResult, 'STEP_{}'.format(step))[i,1]
                        v2 = getattr(stressResult, 'STEP_{}'.format(step))[i,2]
                        
                        sigmaTemp_xx.append(v0) 
                        sigmaTemp_yy.append(v1)
                        sigmaTemp_zz.append(v2)
        
                        v3 = getattr(stressResult, 'STEP_{}'.format(step))[i,3] 
                        v4 = getattr(stressResult, 'STEP_{}'.format(step))[i,4] 
                        v5 = getattr(stressResult, 'STEP_{}'.format(step))[i,5] 
                        tauTemp_xy.append(v3)
                        tauTemp_xz.append(v4)
                        tauTemp_yz.append(v5)
                        
                        v6= mt.sqrt( v0**2 + v1**2 + v2**2  - (v0*v1 + v1*v2 + v2*v1) + 3*(v3**2 + v5**2 + v4**2))
                        sigmaTM_VM.append( v6)
                    
                    sigma_xx.append( sigmaTemp_xx )
                    sigma_yy.append( sigmaTemp_yy )
                    sigma_zz.append( sigmaTemp_zz )
                    tau_xy.append( tauTemp_xy )
                    tau_xz.append( tauTemp_xz )
                    tau_yz.append( tauTemp_yz )
                    sigma_VM.append( sigmaTemp_VM )
                    
            Hdf5.CloseFile(fileId)
            print("I have close the file")
        except:
            Hdf5.CloseFile(fileId)
            print("I have close the file")
            
    solidElementsFlat = []
    for sublist in solidElements1GP:
        for item in sublist:
            solidElementsFlat.append(item.eleTag)
    """
    sigma_xx = [x for _,x in sorted(zip(solidElementsFlat, sigma_xx))]
    sigma_yy = [x for _,x in sorted(zip(solidElementsFlat, sigma_yy))]
    sigma_zz = [x for _,x in sorted(zip(solidElementsFlat, sigma_zz))]
    tau_xy = [x for _,x in sorted(zip(solidElementsFlat, tau_xy))]
    tau_xz = [x for _,x in sorted(zip(solidElementsFlat, tau_xz))]
    tau_yz = [x for _,x in sorted(zip(solidElementsFlat, tau_yz))]
    sigma_VM = [x for _,x in sorted(zip(solidElementsFlat, sigma_VM))]
    """
    sigma_xx = th.list_to_tree(sigma_xx)
    sigma_yy = th.list_to_tree(sigma_yy)
    sigma_zz = th.list_to_tree(sigma_zz)
    tau_xy = th.list_to_tree(tau_xy)
    tau_xz = th.list_to_tree(tau_xz)
    tau_yz = th.list_to_tree(tau_yz)
    sigma_VM = th.list_to_tree(sigma_VM)
# ---------- end bs ----------
vbs = ViewBrickStressesAlpaca4d(AlpacaSolvedModel=ra.AlpacaSolvedModel, step=Slider(0, range=0..10), stressType=Slider(0, range=0..10))  # -> out, Brick, bounds; inputs step: Int32, stressType: Int32, listColor: list of Color
# ---------- vbs: Python ----------
"""
Read Brick Stresses
-
    Args:
        AlpacaSolvedModel:
        step:
        stressType: 
 <=0: sigma_xx
 1: sigma_yy
 2: sigma_zz
 3: tau_xy
 4: tau_xz
 5: tau_yz
 >=6: sigma_VM (Von Mises criterion)
        listColor : one list of color 
    Returns:
"""

ghenv.Component.Name = "View Brick Stresses (Alpaca4d)"
ghenv.Component.NickName = 'VBS'
ghenv.Component.Message = "View Brick Stresses (Alpaca4d)"

import sys
import os
import System
from System.Drawing import Color


import clr
import clrtype
import Rhino.Geometry as rg
import rhinoscriptsyntax as rs
import Grasshopper as gh
import copy
import ghpythonlib.treehelpers as th
from ghpythonlib.components import Bounds
import math as mt

## add alpaca install directory to system path

ghcompfolder = gh.Folders.DefaultAssemblyFolder
if ghcompfolder not in sys.path:
    sys.path.append(ghcompfolder)

try:
    from Alpaca4d import alpaca4d as alpaca
    from Alpaca4d import alpaca4dView as alpacaView
except:
    msg = "Cannot import Alpaca4d. Is the Alpaca4d folder available in " + ghcompfolder + "?"
    ghenv.Component.AddRuntimeMessage(gh.Kernel.GH_RuntimeMessageLevel.Error, msg)



FolderPath = rs.DocumentPath()
os.chdir(FolderPath)


# import costum modules to read the hdf5 file

my_module_name = "Alpaca_StepReader"
my_module = sys.modules.setdefault(my_module_name, type(sys)(my_module_name))

hdfFilePath = os.path.join(ghcompfolder, "Alpaca4d\HDF5CSharp.dll")
clr.AddReferenceToFileAndPath(hdfFilePath)

from HDF5CSharp import Hdf5

try:
    Steps = my_module.Steps
except AttributeError:
    type_2d = type(System.Array.CreateInstance(float, 1, 1))

    class Steps(object):
        __metaclass__ = clrtype.ClrClass
        _clrfields = {"STEP_{}".format(i): type_2d for i in range(1000)} # it will work for model with less than 1000 steps

    my_module.Steps = Steps

if stressType is None or stressType <0 : stressType = 0
elif stressType >= 6 : stressType = 6

if not listColor: listColor = [ System.Drawing.Color.DarkBlue, 
                                System.Drawing.Color.RoyalBlue, 
                                System.Drawing.Color.CornflowerBlue,
                                System.Drawing.Color.LightSkyBlue, 
                                System.Drawing.Color.LightBlue,
                                System.Drawing.Color.CadetBlue,
                                System.Drawing.Color.White,
                                System.Drawing.Color.Yellow,
                                System.Drawing.Color.Orange,
                                System.Drawing.Color.Red,
                                System.Drawing.Color.DarkRed]

checkData = True

if not AlpacaSolvedModel:
    checkData = False
    msg = "Input parameter AlpacaSolvedModel failed to collect data"
    ghenv.Component.AddRuntimeMessage(gh.Kernel.GH_RuntimeMessageLevel.Warning, msg)

if checkData:
    
    step = (int(AlpacaSolvedModel.analysis.NumberOfSteps) - 1) if step is None else step
# read result
    stress = []
    fileId = Hdf5.OpenFile(AlpacaSolvedModel.recorderName, True)
    solidSortedByeleTag = sorted(AlpacaSolvedModel.bricks, key=lambda x: x.eleTag)
    
    solidStandardBrick = []
    solidSSPBrick = []
    solidTetra = []
    
    for item in solidSortedByeleTag:
        if item.elementType == "stdBrick": 
            solidStandardBrick.append(item)
        elif item.elementType == "SSPbrick":
            solidSSPBrick.append(item)
        elif item.elementType == "FourNodeTetrahedron":
            solidTetra.append(item)
    
    solidElements1GP = [solidSSPBrick , solidTetra]
    
    #BRICK
    stressResultSSPBrick = Hdf5.ReadObject[Steps](fileId, "/MODEL_STAGE[1]/RESULTS/ON_ELEMENTS/stresses/121-UnknownMovableObject[400:0:0]/DATA")
    stressResultStandardBrick = Hdf5.ReadObject[Steps](fileId, "/MODEL_STAGE[1]/RESULTS/ON_ELEMENTS/stresses/56-Brick[401:0:0]/DATA")
    
    #TETRA
    stressResultFNTetra = Hdf5.ReadObject[Steps](fileId, "/MODEL_STAGE[1]/RESULTS/ON_ELEMENTS/stresses/179-FourNodeTetrahedron[300:0:0]/DATA")
    #BrickMesh = 
    for j,stressResult in enumerate([stressResultSSPBrick, stressResultFNTetra]):
        for i in range(len(solidElements1GP[j])):
            sigma_xx = getattr(stressResult, 'STEP_{}'.format(step))[i,0]
            sigma_yy = getattr(stressResult, 'STEP_{}'.format(step))[i,1]
            sigma_zz = getattr(stressResult, 'STEP_{}'.format(step))[i,2]
            tau_xy = getattr(stressResult, 'STEP_{}'.format(step))[i,3]
            tau_xz = getattr(stressResult, 'STEP_{}'.format(step))[i,4]
            tau_yz = getattr(stressResult, 'STEP_{}'.format(step))[i,5]
            
            #print(sigma_xx, sigma_yy, sigma_zz, tau_xy, tau_xz, tau_yz)
            #print((sigma_xx - sigma_yy)**2 + (sigma_yy - sigma_zz)**2 + (sigma_zz - sigma_xx)**2 +  6*(tau_xy**2 + tau_yz**2 + tau_xz**2))
            #sigma_VM = mt.sqrt( (sigma_xx**2 + sigma_yy**2 + sigma_zz**2)  - (sigma_xx*sigma_yy + sigma_yy*sigma_zz + sigma_zz*sigma_yy) + 3*(tau_xy**2 + tau_yz**2 + tau_xz**2))
            sigma_VM = (1/mt.sqrt(2))*mt.sqrt(mt.pow(sigma_xx - sigma_yy,2) + mt.pow(sigma_yy - sigma_zz,2) + mt.pow(sigma_zz - sigma_xx,2) +  6*(mt.pow(tau_xy,2) + mt.pow(tau_yz,2) + mt.pow(tau_xz,2)))
            
            stress.append([ sigma_xx, sigma_yy, sigma_zz, tau_xy, tau_xz, tau_yz, sigma_VM ]) 
            
    Hdf5.CloseFile(fileId)
    print("I have close the file")
    
    ListValor = [ row[stressType] for row in stress ]
    bounds = Bounds(ListValor)
    Brick = []
    solidElements1GP = solidSSPBrick + solidTetra
    Brick = alpacaView.ColorBrickStress( solidElements1GP, ListValor, bounds, listColor)
# ---------- end vbs ----------

dm = DeformedModelAlpaca4d(AlpacaSolvedModel=ra.AlpacaSolvedModel, scale="1e-2", typeColor=Slider(1, range=0..10))  # -> DefModel, bounds; inputs step: Int32, extrudeModel: Boolean, typeColor: Int32, listColor: list of Color
# ---------- dm: Python ----------
"""View Deformed model
    Args:
        AlpacaSolvedModel: Output of Analyses solver
        step:
        scale: Multiplication factor for displacement
        extrudeModel:  
True : view extruded model
else : view stick model
        typeColor:  View relative color of the traslation
<=0 : view traslation X 
1 : view traslation Y
2 : view traslation Z
>= 3 : view resulting displacement.
        listColor : one list of color 

    Output:
       DefModel: view deformed model
       bounds: max end min of displacement of the structure 
"""

ghenv.Component.Name = "Deformed Model (Alpaca4d)"
ghenv.Component.NickName = 'DM'
ghenv.Component.Message = "Deformed Model (Alpaca4d)"

from ghpythonlib.componentbase import executingcomponent as component
import System
import rhinoscriptsyntax as rs

import sys
import os
import clr
import clrtype
import Rhino.Geometry as rg
import Rhino as rc
import math as mt
import Grasshopper as gh
import ghpythonlib.treehelpers as th
from ghpythonlib.components import ConstructDomain

ghcompfolder = gh.Folders.DefaultAssemblyFolder
if ghcompfolder not in sys.path:
    sys.path.append(ghcompfolder)
try:
    from Alpaca4d import alpaca4dView as alpacaView
except:
    msg = "Cannot import Alpaca4d. Is the Alpaca4d folder available in " + ghcompfolder + "?"
    ghenv.Component.AddRuntimeMessage(gh.Kernel.GH_RuntimeMessageLevel.Error, msg)
    
FolderPath = rs.DocumentPath()
os.chdir(FolderPath)

ghcompfolder = gh.Folders.DefaultAssemblyFolder
my_module_name = "Alpaca_StepReader" # replace this with something unique that doesn't collide with a real module!
my_module = sys.modules.setdefault(my_module_name, type(sys)(my_module_name))

hdfFilePath = os.path.join(ghcompfolder, "Alpaca4d\HDF5CSharp.dll")
clr.AddReferenceToFileAndPath(hdfFilePath)


from HDF5CSharp import Hdf5

class MyComponent(component):
    
    def RunScript(self, AlpacaSolvedModel, step = None, scale = None , extrudeModel = None, typeColor = None, listColor = [] ):
        import sys
        
        self.extrudeModel = extrudeModel
        
        self.defModel1 = []
        self.defModel2 = []
        self.defModel3 = []
        
        self.beamColor = []
        

        if step == None:
            step = 0
        if scale == None:
            scale = 1
        if extrudeModel == None:
            extrudeModel = False
        if typeColor == None:
            typeColor = 3
        
        if not listColor: listColor = [ System.Drawing.Color.DarkViolet, 
                                        System.Drawing.Color.BlueViolet, 
                                        System.Drawing.Color.RoyalBlue, 
                                        System.Drawing.Color.CornflowerBlue,
                                        System.Drawing.Color.LightSkyBlue, 
                                        System.Drawing.Color.LightBlue,
                                        System.Drawing.Color.CadetBlue,
                                        System.Drawing.Color.LightGreen,
                                        System.Drawing.Color.GreenYellow,
                                        System.Drawing.Color.Yellow,
                                        System.Drawing.Color.Orange,
                                        System.Drawing.Color.Red,
                                        System.Drawing.Color.DarkRed]
        
        
        ghcompfolder = gh.Folders.DefaultAssemblyFolder
        if ghcompfolder not in sys.path:
            sys.path.append(ghcompfolder)
    
        try:
            Steps = my_module.Steps
        except AttributeError:
            type_2d = type(System.Array.CreateInstance(float, 1, 1))
                
            class Steps(object):
                __metaclass__ = clrtype.ClrClass
                _clrfields = {"STEP_{}".format(i): type_2d for i in range(1000)} # it will work for model with less than 1000 steps
                
            my_module.Steps = Steps
            
        checkData = True
        
        if not AlpacaSolvedModel:
            checkData = False
            msg = "Input parameter AlpacaSolvedModel failed to collect data"
            ghenv.Component.AddRuntimeMessage(gh.Kernel.GH_RuntimeMessageLevel.Warning, msg)
        else:
            try:
                fileId = Hdf5.OpenFile(AlpacaSolvedModel.recorderName, True)
                numberOfPoints = len(AlpacaSolvedModel.uniquePoints) #
                        
                        
                displacementResult = Hdf5.ReadObject[Steps](fileId, "/MODEL_STAGE[1]/RESULTS/ON_NODES/DISPLACEMENT/DATA")
                displacement = []
                rotation = []
                dispNodeList = []
                for i in range(numberOfPoints):
                    tag = i + 1
                    vx = getattr(displacementResult, 'STEP_{}'.format(step))[i,0]
                    vy = getattr(displacementResult, 'STEP_{}'.format(step))[i,1]
                    vz = getattr(displacementResult, 'STEP_{}'.format(step))[i,2]
                    trasl = rg.Vector3d(vx,vy,vz)
                    displacement.append(trasl)
                    dispNodeList.append( [tag, trasl] )
                    
                Hdf5.CloseFile(fileId)
                print("I have closed the file")
            
                dispNodeDict = dict( dispNodeList )
                #---------------------------------------------------#
                defEleVector1 = alpacaView.BeamVectorDef(AlpacaSolvedModel,dispNodeDict) #beam
                defEleVector2 = alpacaView.ShellVectorDef(AlpacaSolvedModel,dispNodeDict) #shell
                defEleVector3 = alpacaView.BrickVectorDef(AlpacaSolvedModel,dispNodeDict) #shell
                bound = alpacaView.boundsDef(displacement, typeColor)
                if self.extrudeModel == None or self.extrudeModel == False:
                    print(self.extrudeModel== False)
                    #BEAM
                    defModel1 = alpacaView.BeamDef(AlpacaSolvedModel, dispNodeDict,scale)
                    self.defModel1, self.beamColor = alpacaView.ColorBeamDef( defModel1, defEleVector1, bound, listColor, typeColor)
                    #SHELL
                    defModel2 = alpacaView.ShellDef(AlpacaSolvedModel,dispNodeDict,scale)
                    #BRICK
                    defModel3 = alpacaView.BrickDef(AlpacaSolvedModel,dispNodeDict,scale)
                else:
                    #BEAM
                    defModel1 = alpacaView.BeamDefExtrude(AlpacaSolvedModel, dispNodeDict,scale)
                    self.defModel1 = alpacaView.ColorBeamDefExtrude( defModel1, defEleVector1, bound, listColor, typeColor)
                    #SHELL
                    defModel2 = alpacaView.ShellDefExtrude(AlpacaSolvedModel,dispNodeDict,scale)
                    #BRICK
                    defModel3 = alpacaView.BrickDef(AlpacaSolvedModel,dispNodeDict,scale)
                    
                #SHELL COLOR
                self.defModel2 = alpacaView.ColorShellDef( defModel2, defEleVector2 , bound, listColor, typeColor, extrudeModel )
                #BRICK COLOR
                self.defModel3 = alpacaView.ColorBrickDef( defModel3, defEleVector3 , bound, listColor, typeColor)
                DefModel = th.list_to_tree(self.defModel1 + defModel2 + defModel3)
                bounds = ConstructDomain(bound[0], bound[1])
                return (DefModel, bounds)
            except:
                Hdf5.CloseFile(fileId)
                print("I have closed the file due to exception")
            # return outputs if you have them; here I try it for you:
        
        
    def DrawViewportWires(self,arg):
        for iMesh in self.defModel2 :
            colorWirframe = System.Drawing.Color.Black
            arg.Display.DrawMeshWires(iMesh, colorWirframe)
            
        for iMesh in self.defModel3 :
            colorWirframe = System.Drawing.Color.Black
            arg.Display.DrawMeshWires(iMesh, colorWirframe)
        if self.extrudeModel is None or self.extrudeModel is False:
            thickness =2
            for iBeam, iColor in zip(self.defModel1, self.beamColor) :
                for jBeam, jColor in zip(iBeam, iColor):
                    arg.Display.DrawCurve(jBeam, jColor, thickness)
        else:
            for iBeam in self.defModel1 :
                colorWirframe = System.Drawing.Color.Black
                arg.Display.DrawMeshWires(iBeam, colorWirframe)
# ---------- end dm ----------
python = GhPythonScript()  # -> out, a
# ---------- python: Python ----------
__author__ = "Domen"
__version__ = "2021.04.21"

import rhinoscriptsyntax as rs
import math as mt


print(mt.pow(2,2))
# ---------- end python ----------
graph = QuickGraph(bs.sigma_xx, SortOrder=0)
