# Grasshopper definition developmentScript_CaseStudy.gh (Grasshopper 1.0.7)
# plug-ins: MeshEdit Components, Pufferfish, Human, Kangaroo Components, Weaverbird, Kangaroo2 Components, karambaGH

# Format Engineers CAD Information Issue Disclaimer
# 
# Project: PROJECT NAME
# 
# You should use this model for reference purposes only to assist in co-ordinating your work and is supplementary to formally issued drawings. Once the data is introduced into your own CAD or other system Format Engineers Ltd. can take no responsibility for its accuracy.
# 
# The last set of formally issued paper drawings are the contractual documents which represent the current stage of design development. If you have any queries, please contact the project CAD co-ordinator or the CAD Development Team.
# 
# Changes:
# 
# YYYY-MM-DD: Summary of changes
# 
# Usage notes:
# 
# This definition includes a basic implementation of Merbarki's Farthest Point Seeding algorithm (2005), adapted for tracing lines of principal curvature on NURBS surfaces. Requires modified Triangle.NET, if this isn't attached then... good luck! There are currently two main limitations: (a) this implementation measures density in parameter space, and (b) it doesn't include the dynamic refinement of density that Mebarki suggests.
mesh = Mesh(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)

# ----
# Concrete Shell
mesh_2 = Mesh(mesh)
refine = Refine(Mesh=mesh_2, Level=1)
mjoin = MeshJoin(Meshes=flatten(refine))
explode = MeshExplode(Mesh=mjoin, Interpolate=False)
mjoin_2 = MeshJoin(Meshes=flatten(explode))

nv = NakedVertices(Mesh=mjoin_2)  # -> ClothedIndex, NakedIndex, ClothedPts, NakedPts
duppt = RemoveDuplicatePts(Points=nv.NakedPts, Tolerance=0.01)

pt = Point(duppt)
pdecon = Deconstruct(Point=pt)  # -> XComponent, YComponent, ZComponent
bnd = Bounds(Numbers=pdecon.ZComponent)
dedomain = DeconstructDomain(Domain=bnd)  # -> Start, End
addition = Addition(A="0.01", B=dedomain.Start)
smaller = SmallerThan(FirstNumber=pdecon.ZComponent, SecondNumber=addition)  # -> SmallerThan, OrEqualTo
cull = CullPattern(List=pt, CullPattern=smaller.SmallerThan)
rdpoints = RemoveDuplicatePointsKaramba3D(Point=cull, LimitDistance=0.005)  # -> OutPoint, Info, Indexes

weldvertices = MeshWeldVertices(Mesh=mjoin_2, Tolerance=0.01)  # -> RuntimeMessage, Mesh
mesh_3 = Mesh(weldvertices.Mesh)

# ----
# nDMaterial
# ElasticIsotropic
python = GhPythonScript(E="210", v="0.3", rho="7850")  # -> out, nDMaterial
# ---------- python: Python ----------
"""
Create a support
-
    Args:
        name:
        E:
        G:
        v:
        rho:
    Returns:
        nDMaterial:
"""


import sys
import Rhino.Geometry as rg
import Grasshopper as gh
import copy


## add alpaca install directory to system path

ghcompfolder = gh.Folders.DefaultAssemblyFolder
if ghcompfolder not in sys.path:
    sys.path.append(ghcompfolder)

try:
    from Alpaca4d import alpaca4d as alpaca
except:
    msg = "Cannot import Alpaca4d. Is the Alpaca4d folder available in " + ghcompfolder + "?"
    ghenv.Component.AddRuntimeMessage(gh.Kernel.GH_RuntimeMessageLevel.Error, msg)


checkData = True

if not E:
    checkData = False
    msg = "Input parameter E failed to collect data"
    ghenv.Component.AddRuntimeMessage(gh.Kernel.GH_RuntimeMessageLevel.Warning, msg)

if not G and not v:
    checkData = False
    msg = "Input parameter G or v failed to collect data"
    ghenv.Component.AddRuntimeMessage(gh.Kernel.GH_RuntimeMessageLevel.Warning, msg)

if not rho:
    checkData = False
    msg = "Input parameter rho failed to collect data"
    ghenv.Component.AddRuntimeMessage(gh.Kernel.GH_RuntimeMessageLevel.Warning, msg)

if checkData:
    nDMaterial = alpaca.ElasticIsotropic(name, E, G, rho, v)
# ---------- end python ----------

mesh_4 = Mesh(mesh)  # disabled
bbox = BoundingBox(Content=mesh_4, Plane=PlaneXY(0, 0, 0), UnionBox=True)  # -> Box, Box_2; disabled

pt_2 = Point(rdpoints.OutPoint)

# ----
# Plate Fiber Section
python_2 = GhPythonScript(thickness="15", nDMaterial=python.nDMaterial)  # -> out, fiberSection
# ---------- python_2: Python ----------
"""
Create a support
-
    Args:
        secName:
        thickness:
        nDMaterial:
    Returns:
        fiberSection:
"""


import sys
import Rhino.Geometry as rg
import Grasshopper as gh
import copy


## add alpaca install directory to system path

ghcompfolder = gh.Folders.DefaultAssemblyFolder
if ghcompfolder not in sys.path:
    sys.path.append(ghcompfolder)

try:
    from Alpaca4d import alpaca4d as alpaca
except:
    msg = "Cannot import Alpaca4d. Is the Alpaca4d folder available in " + ghcompfolder + "?"
    ghenv.Component.AddRuntimeMessage(gh.Kernel.GH_RuntimeMessageLevel.Error, msg)


checkData = True

if not thickness:
    checkData = False
    msg = "Input parameter thickness failed to collect data"
    ghenv.Component.AddRuntimeMessage(gh.Kernel.GH_RuntimeMessageLevel.Warning, msg)

if not nDMaterial:
    checkData = False
    msg = "Input parameter nDMaterial failed to collect data"
    ghenv.Component.AddRuntimeMessage(gh.Kernel.GH_RuntimeMessageLevel.Warning, msg)

if checkData:
    fiberSection = alpaca.PlateFiberSection(secName, thickness, nDMaterial)
# ---------- end python_2 ----------

wbnaked = WeaverbirdsNakedBoundary(MeshClosedPolylines=mesh_3)
demesh = DeconstructMesh(Mesh=mesh_3)  # -> Vertices, Faces, Colours, Normals

panel = Panel("0.15")  # disabled
offmsh = OffsetMesh(Mesh=mesh_4, Distance=panel, BothSides=False, CreateSolid=True)  # disabled
medges = MeshEdges(Mesh=offmsh)  # -> NakedEdges, InteriorEdges, NonManifoldEdges; disabled
swatch = ColourSwatch(SwatchColor=RGB(0, 0, 0))  # disabled
swatch_2 = ColourSwatch(SwatchColor=RGB(255, 255, 255))  # disabled
crv = Curve(medges.NakedEdges)  # disabled
swatch_3 = ColourSwatch(SwatchColor=RGB(0, 0, 0))  # disabled
crv_2 = Curve(medges.InteriorEdges)  # disabled
panel_2 = Panel("3")  # disabled
panel_3 = Panel("1")  # disabled
previewlw = CustomPreviewLineweights(Geometry=crv, Shader=swatch, Thickness=panel_2, Absolute=False)  # disabled
previewlw_2 = CustomPreviewLineweights(Geometry=crv_2, Shader=swatch_3, Thickness=panel_3, Absolute=False)  # disabled
preview = CustomPreview(Geometry=offmsh, Material=swatch_2)  # disabled

wbnaked_2 = WeaverbirdsNakedBoundary(MeshClosedPolylines=mesh_4)  # disabled
debrep = DeconstructBrep(Brep=bbox.Box)  # -> Faces, Edges, Vertices; disabled
splitatcorners = SplitAtCorners(Poly=wbnaked_2, Angle=1)  # -> Corners, Parts; disabled
curvepoint = PointOnCurve(splitatcorners.Parts, parameter=0.5)  # disabled
demesh_2 = DeconstructMesh(Mesh=mesh_4)  # -> Vertices, Faces, Colours, Normals; disabled
crv_3 = Curve(debrep.Edges)  # disabled
offset = OffsetCurve(Curve=crv_3, Distance=1, Plane=PlaneXY(0, 0, 0), Corners=1)  # disabled
pdecon_2 = Deconstruct(Point=demesh_2.Vertices)  # -> XComponent, YComponent, ZComponent; disabled
pdecon_3 = Deconstruct(Point=curvepoint)  # -> XComponent, YComponent, ZComponent; disabled
panel_4 = Panel("0.1")  # disabled
sort = SortList(Keys=pdecon_2.ZComponent, ValuesA=demesh_2.Vertices)  # -> Keys, ValuesA; disabled
larger = LargerThan(FirstNumber=pdecon_3.ZComponent, SecondNumber=panel_4)  # -> LargerThan, OrEqualTo; disabled
item = ListItem(List=reverse(sort.Keys), Index=0, Wrap=True)  # disabled
item_2 = ListItem(List=reverse(sort.ValuesA), Index=0, Wrap=True)  # disabled
cull_2 = CullPattern(List=splitatcorners.Parts, CullPattern=larger.LargerThan)  # -> flatten(List); disabled
pt_3 = Point()  # disabled
join = JoinCurves(Curves=cull_2, Preserve=False)  # disabled
number_slider = Slider(0.2, range=0.01..0.5)  # disabled
x_tremez = Extremes(Curve=join, Plane=PlaneXY(0, 0, 0))  # -> Highest, Lowest; disabled
panel_5 = Panel("0.30")  # disabled
pt_4 = Point(x_tremez.Highest)  # disabled
line = LineSDL(Start=item_2, Direction=Vector(0, 0, 1), Length=panel_5)  # disabled
project = Project(Geometry=pt_4, Plane=PlaneXY(0, 0, 0))  # -> Geometry, Transform; disabled
ln = Line(StartPoint=pt_4, EndPoint=project.Geometry)  # disabled
number_slider_2 = Slider(0.2, range=0.01..0.5)  # disabled
markdim = MarkerDimension(Line=line, Text="Z={2:0.0}", Size=number_slider)  # disabled
linedim = LineDimension(Line=ln, Text="{0:0.00}", Size=number_slider_2)  # disabled
linedim_2 = LineDimension(Line=offset, Text="{0:0.00}", Size=number_slider)  # disabled

sort_2 = SortList(Keys=wbnaked, ValuesA=wbnaked)  # -> Keys, ValuesA

# ----
# Support
toggle = BooleanToggle(False)
toggle_2 = BooleanToggle(True)
python_3 = GhPythonScript(Pos=pt_2, Tx=toggle_2, Ty=toggle_2, Tz=toggle_2, Rx=toggle, Ry=toggle, Rz=toggle)  # -> Support; inputs Pos: Point3d, Tx: Boolean, Ty: Boolean, Tz: Boolean, Rx: Boolean, Ry: Boolean, Rz: Boolean
# ---------- python_3: Python ----------
"""
Create a support
-
    Args:
        Pos:
        Tx:
        Ty:
        Tz:
        Rx:
        Ry:
    Returns:
        Support:
"""



from ghpythonlib.componentbase import executingcomponent as component
import Grasshopper, GhPython
import System
import Rhino
import rhinoscriptsyntax as rs

class MyComponent(component):
    
    def RunScript(self, Pos, Tx, Ty, Tz, Rx, Ry, Rz):
        
        
        import sys
        import Rhino.Geometry as rg
        import Grasshopper as gh
        
        
        ## add alpaca install directory to system path
        
        ghcompfolder = gh.Folders.DefaultAssemblyFolder
        if ghcompfolder not in sys.path:
            sys.path.append(ghcompfolder)
        
        try:
            from Alpaca4d import alpaca4d as alpaca
        except:
            msg = "Cannot import Alpaca4d. Is the Alpaca4d folder available in " + ghcompfolder + "?"
            ghenv.Component.AddRuntimeMessage(gh.Kernel.GH_RuntimeMessageLevel.Error, msg)
        
        checkData = True
        
        Tx = int(False) if Tx is None else int(Tx)
        Ty = int(False) if Ty is None else int(Ty)
        Tz = int(False) if Tz is None else int(Tz)
        Rx = int(False) if Rx is None else int(Rx)
        Ry = int(False) if Ry is None else int(Ry)
        Rz = int(False) if Rz is None else int(Rz)
        
        
        if not Pos:
            checkData = False
            msg = "Input parameter Pos failed to collect data"
            ghenv.Component.AddRuntimeMessage(gh.Kernel.GH_RuntimeMessageLevel.Warning, msg)
        
        if checkData:
            Support = alpaca.Support(Pos, Tx, Ty, Tz, Rx, Ry, Rz)
            return Support
# ---------- end python_3 ----------

item_3 = ListItem(List=sort_2.ValuesA, Index=0, Wrap=True)
explode_2 = Explode(Curve=item_3, Recursive=True)  # -> Segments, Vertices

# ----
# Constant Time Series
# Linear Time Series
python_4 = GhPythonScript()  # -> timeSeries, Graph
# ---------- python_4: Python ----------
"""
Create a PointLoad
-
    Args:
        tStart:
        tEnd:
        period:
        factor:
        shift:
    Returns:
        timeSeries:
        Graph:
"""

import sys
import Rhino.Geometry as rg
import Grasshopper as gh
import copy
import math


## add alpaca install directory to system path

ghcompfolder = gh.Folders.DefaultAssemblyFolder
if ghcompfolder not in sys.path:
    sys.path.append(ghcompfolder)

try:
    from Alpaca4d import alpaca4d as alpaca
except:
    msg = "Cannot import Alpaca4d. Is the Alpaca4d folder available in " + ghcompfolder + "?"
    ghenv.Component.AddRuntimeMessage(gh.Kernel.GH_RuntimeMessageLevel.Error, msg)

def ConstantSeries(x):
    return x



checkData = True

if not constantFactor:
    constantFactor = 1


if checkData:
    timeSeries = alpaca.TimeSeriesConstant(constantFactor)
    
    Graph = []
    
    for x in range(10):
        Graph.append(ConstantSeries(constantFactor))
# ---------- end python_4 ----------
python_5 = GhPythonScript()  # -> timeSeries, Graph
# ---------- python_5: Python ----------
"""
Create a PointLoad
-
    Args:
        tStart:
        tEnd:
        period:
        factor:
        shift:
    Returns:
        timeSeries:
        Graph:
"""

import sys
import Rhino.Geometry as rg
import Grasshopper as gh
import copy
import math


## add alpaca install directory to system path

ghcompfolder = gh.Folders.DefaultAssemblyFolder
if ghcompfolder not in sys.path:
    sys.path.append(ghcompfolder)

try:
    from Alpaca4d import alpaca4d as alpaca
except:
    msg = "Cannot import Alpaca4d. Is the Alpaca4d folder available in " + ghcompfolder + "?"
    ghenv.Component.AddRuntimeMessage(gh.Kernel.GH_RuntimeMessageLevel.Error, msg)


def linearSeries(x):
    return x



checkData = True

if not linearFactor:
    linearFactor = 1




if checkData:
    timeSeries = alpaca.TimeSeriesLinear(linearFactor)
    
    Graph = []
    
    for x in range(10):
        Graph.append(linearSeries(x * linearFactor))
# ---------- end python_5 ----------

# ----
# Mesh to Shell
# ShellMITC4, ShellNLDKGT
python_6 = GhPythonScript(Mesh=mesh_3, CrossSection=python_2.fiberSection)  # -> out, Shell; inputs Mesh: Mesh, Colour: Color
# ---------- python_6: Python ----------
"""
Create a support
-
    Args:
        Mesh:
        CrossSection:
        Colour:
    Returns:
        Shell:
"""


import sys
import Rhino.Geometry as rg
import Grasshopper as gh
import copy
from System.Drawing import Color


## add alpaca install directory to system path

ghcompfolder = gh.Folders.DefaultAssemblyFolder
if ghcompfolder not in sys.path:
    sys.path.append(ghcompfolder)

try:
    from Alpaca4d import alpaca4d as alpaca
except:
    msg = "Cannot import Alpaca4d. Is the Alpaca4d folder available in " + ghcompfolder + "?"
    ghenv.Component.AddRuntimeMessage(gh.Kernel.GH_RuntimeMessageLevel.Error, msg)


checkData = True

if not Mesh:
    checkData = False
    msg = "Input parameter Mesh failed to collect data"
    ghenv.Component.AddRuntimeMessage(gh.Kernel.GH_RuntimeMessageLevel.Warning, msg)

if not CrossSection:
    checkData = False
    msg = "Input parameter CrossSection failed to collect data"
    ghenv.Component.AddRuntimeMessage(gh.Kernel.GH_RuntimeMessageLevel.Warning, msg)

if not Colour:
    Colour = Color.Blue


if checkData:
    
    Mesh.Unweld(0,True)
    explodedMesh = Mesh.ExplodeAtUnweldedEdges()
    if explodedMesh.Length > 0:
        Shell = []
        for mesh in explodedMesh:
            if mesh.Vertices.Count == 4:
                Shell.append(alpaca.ShellMITC4(mesh, copy.deepcopy(CrossSection), Colour))
            elif mesh.Vertices.Count == 3:
                Shell.append(alpaca.ShellNLDKGT(mesh, copy.deepcopy(CrossSection), Colour))
    elif explodedMesh.Length == 0:
        if Mesh.Vertices.Count == 4:
                Shell = alpaca.ShellMITC4(Mesh, copy.deepcopy(CrossSection), Colour)
        elif Mesh.Vertices.Count == 3:
            Shell = alpaca.ShellNLDKGT(Mesh, copy.deepcopy(CrossSection), Colour)
    
    #Vertices = Shell.Mesh.Vertices.ToPoint3dArray()
# ---------- end python_6 ----------

duppt_2 = RemoveDuplicatePts(Points=explode_2.Vertices, Tolerance=0.01)
avr = Average(Input=duppt_2)

# ----
# Rigid Diaphgram
python_7 = GhPythonScript(masterNode=avr, slaveNodes=duppt_2)  # -> out, RigidDiaphragm; inputs masterNode: Point3d, slaveNodes: list of Point3d
# ---------- python_7: Python ----------
"""
Create a support
-
    Args:
        masterNode:
        slaveNodes:
    Returns:
        RigidDiaphragm:
"""


import sys
import Rhino.Geometry as rg
import Grasshopper as gh
import copy
from System.Drawing import Color


## add alpaca install directory to system path

ghcompfolder = gh.Folders.DefaultAssemblyFolder
if ghcompfolder not in sys.path:
    sys.path.append(ghcompfolder)

try:
    from Alpaca4d import alpaca4d as alpaca
except:
    msg = "Cannot import Alpaca4d. Is the Alpaca4d folder available in " + ghcompfolder + "?"
    ghenv.Component.AddRuntimeMessage(gh.Kernel.GH_RuntimeMessageLevel.Error, msg)


checkData = True

if not masterNode:
    checkData = False
    msg = "Input parameter masterNode failed to collect data"
    ghenv.Component.AddRuntimeMessage(gh.Kernel.GH_RuntimeMessageLevel.Warning, msg)

if not slaveNodes:
    checkData = False
    msg = "Input parameter slaveNodes failed to collect data"
    ghenv.Component.AddRuntimeMessage(gh.Kernel.GH_RuntimeMessageLevel.Warning, msg)


if checkData:
    RigidDiaphragm = alpaca.RigidDiaphragm(masterNode, slaveNodes)
# ---------- end python_7 ----------

# ----
# we should find a user friendly approach for AnalysisType and Test input
# Analysis
# It can be scary to insert all this value.
# Maybe default setting in Analysis type
# and use only numIncr
panel_6 = Panel("LoadControl 0.1")
list = ValueList({"Linear", "Newton", "NewtonLineSearch", "ModifiedNewton", "KrylovNewton", "SecantNewton", "BFGS", "Broyden"}, selected="ModifiedNewton")
list_2 = ValueList({"BandGen", "BandSPD", "ProfileSPD", "SuperLU", "UmfPack", "FullGeneral", "SparseSYM"}, selected="BandSPD")
list_3 = ValueList({"RCM", "AMD", "Plain"}, selected="RCM")
list_4 = ValueList({"Static", "Transient"}, selected="Static")
python_8 = GhPythonScript(
    Constraint="Transformation",
    Numberer=list_3,
    System=list_2,
    Test="NormDispIncr 1.0e-6 12 5",
    Algorithm=list,
    Integrator="Newmark 0.5 0.25 ",
    AnalysisType=list_4,
    AnalysesSteps="10")  # -> out, Analysis
# ---------- python_8: Python ----------
from Alpaca4d import alpaca4d as alpaca

# default Value

ConstraintList = ['Plain', 'Transformation']


for item in ConstraintList:
    if Constraint.lower() == item.lower():
        print(item)
        Constraint = item


# default Value

NumbererList = ['RCM', 'AMD', 'Plain', 'ParallelPlain', 'ParallelRCM']

for i,item in enumerate(NumbererList):
    if Numberer.lower() == item.lower():
        Numberer = item



# default Value

SystemList = ['BandGen', 'BandSPD', 'ProfileSPD', 'SuperLU', 'UmfPack', 'FullGeneral', 'SparseSYM']

for i,item in enumerate(SystemList):
    if System.lower() == item.lower():
        System = item


# default Value

AnalysisTypeList = ['Static', 'Transient']

for item in AnalysisTypeList:
    if AnalysisType.lower() == item.lower():
        AnalysisType = item




Analysis = alpaca.Analysis(Constraint, Numberer,System,Test,Algorithm,Integrator,AnalysisType, AnalysesSteps)

print(Analysis.write_tcl())
# ---------- end python_8 ----------

panel_7 = Panel("500 0.01")
reset = Button()
run = BooleanToggle(False)
python_9 = PythonScript(Run=run, Reset=reset, Interval=Slider(1, range=1..1000), maxValue="500")  # -> Counter; inputs Run: Boolean
# ---------- python_9: Python ----------
import Grasshopper as gh

def updateComponent(interval):
    
    """ Updates this component, similar to using a grasshopper timer """
    
    # Define callback action
    def callBack(e):
        ghenv.Component.ExpireSolution(False)
        
    # Get grasshopper document
    ghDoc = ghenv.Component.OnPingDocument()
    
    # Schedule this component to expire
    ghDoc.ScheduleSolution(interval,gh.Kernel.GH_Document.GH_ScheduleDelegate(callBack)) # Note that the first input here is how often to update the component (in milliseconds)

# Instantiate/reset persisent starting counter variable
if "myCounter" not in globals() or Reset:
    myCounter = 0

# Update the variable and component
if Run and not Reset:
    myCounter +=1
    updateComponent(Interval)
    print(myCounter)
    if myCounter > maxValue:
        myCounter = 0


# Output counter
Counter = myCounter
# ---------- end python_9 ----------
panel_8 = Panel(python_9)

panel_9 = Panel("10")  # disabled
panel_10 = Panel("21000")  # disabled
panel_11 = Panel("0.3")  # disabled
panel_12 = Panel("8070")  # disabled
panel_13 = Panel("0.3")  # disabled
panel_14 = Panel("21000")  # disabled
panel_15 = Panel("8070")  # disabled
panel_16 = Panel("500")  # disabled
python_10 = GhPythonScript(
    Ex=panel_10,
    Ey=panel_10,
    Ez=panel_10,
    vxy=panel_11,
    vyz=panel_11,
    vzx=panel_11,
    Gxy=panel_12,
    Gyz=panel_12,
    Gzy=panel_12,
    rho=panel_9)  # -> out, nDMaterial; disabled
# ---------- python_10: Python ----------
import opensees.openseesGH as alpaca


nDMaterial = alpaca.ElasticOrthotropic(name, Ex,Ey,Ez,vxy,vyz,vzx,Gxy,Gyz,Gzy,rho,fy)




print(nDMaterial.write_tcl())
# ---------- end python_10 ----------
python_11 = GhPythonScript(
    Ex=panel_14,
    Ey=panel_14,
    Ez=panel_14,
    vxy=panel_13,
    vyz=panel_13,
    vzx=panel_13,
    Gxy=panel_15,
    Gyz=panel_15,
    Gzy=panel_15,
    rho=panel_16)  # -> out, nDMaterial; disabled
# ---------- python_11: Python ----------
import opensees.openseesGH as alpaca


nDMaterial = alpaca.ElasticOrthotropic(name, Ex,Ey,Ez,vxy,vyz,vzx,Gxy,Gyz,Gzy,rho,fy)

print(nDMaterial.rho)
print(nDMaterial.vxy)

print(nDMaterial.write_tcl())
# ---------- end python_11 ----------
merge = Merge(Data1=python_10.nDMaterial, Data2=python_11.nDMaterial, Data3=python_10.nDMaterial)  # disabled
panel_17 = Panel("""10
10
10""")  # disabled
panel_18 = Panel("CLT")  # disabled
python_12 = GhPythonScript(sectionName=panel_18, materials=merge, thicknesses=panel_17)  # -> out, layeredShellSection; inputs materials: list, thicknesses: list; disabled
# ---------- python_12: Python ----------
import opensees.openseesGH as alpaca

#layeredShellSection = alpaca.LayeredShell(sectionName, materials, thicknesses)
#layeredShellSectionPY = alpaca.LayeredShell(sectionName, materials, thicknesses).write_py()

layeredShellSection = alpaca.LayeredShell(sectionName, materials, thicknesses)
# ---------- end python_12 ----------

# ----
# ForceBeamColumn
swatch_4 = ColourSwatch(SwatchColor=RGB(255, 255, 255))
python_13 = GhPythonScript(Colour=swatch_4, Orient="3")  # -> out, element; inputs Line: Curve, Colour: Color
# ---------- python_13: Python ----------
"""
Create a support
-
    Args:
        Line:
        CrossSection:
        Colour:
        Orient:
    Returns:
        element:
"""


import sys
import Rhino.Geometry as rg
import Grasshopper as gh
import copy


## add alpaca install directory to system path

ghcompfolder = gh.Folders.DefaultAssemblyFolder
if ghcompfolder not in sys.path:
    sys.path.append(ghcompfolder)

try:
    from Alpaca4d import alpaca4d as alpaca
except:
    msg = "Cannot import Alpaca4d. Is the Alpaca4d folder available in " + ghcompfolder + "?"
    ghenv.Component.AddRuntimeMessage(gh.Kernel.GH_RuntimeMessageLevel.Error, msg)


checkData = True

if not Line:
    checkData = False
    msg = "Input parameter Line failed to collect data"
    ghenv.Component.AddRuntimeMessage(gh.Kernel.GH_RuntimeMessageLevel.Warning, msg)


if not CrossSection:
    checkData = False
    msg = "Input parameter CrossSection failed to collect data"
    ghenv.Component.AddRuntimeMessage(gh.Kernel.GH_RuntimeMessageLevel.Warning, msg)

if not Colour:
    Colour = Color.Red

if not Orient:
    Orient = 0.0


if checkData:
    newCrossSection = copy.deepcopy(CrossSection)
    element = alpaca.ForceBeamColumn(Line, newCrossSection, Colour, Orient)
# ---------- end python_13 ----------

# ----
# Layered Shell
python_14 = GhPythonScript()  # -> out, LayeredShell; inputs thicknesses: list, nDMaterials: list
# ---------- python_14: Python ----------
"""
Create a support
-
    Args:
        secName:
        thicknesses:
        nDMaterials:
    Returns:
        fiberSection:
"""


import sys
import Rhino.Geometry as rg
import Grasshopper as gh
import copy


## add alpaca install directory to system path

ghcompfolder = gh.Folders.DefaultAssemblyFolder
if ghcompfolder not in sys.path:
    sys.path.append(ghcompfolder)

try:
    from Alpaca4d import alpaca4d as alpaca
except:
    msg = "Cannot import Alpaca4d. Is the Alpaca4d folder available in " + ghcompfolder + "?"
    ghenv.Component.AddRuntimeMessage(gh.Kernel.GH_RuntimeMessageLevel.Error, msg)


checkData = True

if not thicknesses:
    checkData = False
    msg = "Input parameter thicknesses failed to collect data"
    ghenv.Component.AddRuntimeMessage(gh.Kernel.GH_RuntimeMessageLevel.Warning, msg)

if not nDMaterials:
    checkData = False
    msg = "Input parameter nDMaterials failed to collect data"
    ghenv.Component.AddRuntimeMessage(gh.Kernel.GH_RuntimeMessageLevel.Warning, msg)

if checkData:
    LayeredShell = alpaca.LayeredShell(secName, nDMaterials, thicknesses)
# ---------- end python_14 ----------

# ----
# equalDOF
python_15 = GhPythonScript()  # -> out, Constraint; inputs masterNode: Point3d, slaveNode: Point3d, dof_x: Boolean, dof_y: Boolean, dof_z: Boolean, dof_xx: Boolean, dof_yy: Boolean, dof_zz: Boolean
# ---------- python_15: Python ----------
"""
Create a support
-
    Args:
        masterNode:
        slaveNodes:
    Returns:
        RigidDiaphragm:
"""


import sys
import Rhino.Geometry as rg
import Grasshopper as gh
import copy
from System.Drawing import Color


## add alpaca install directory to system path

ghcompfolder = gh.Folders.DefaultAssemblyFolder
if ghcompfolder not in sys.path:
    sys.path.append(ghcompfolder)

try:
    from Alpaca4d import alpaca4d as alpaca
except:
    msg = "Cannot import Alpaca4d. Is the Alpaca4d folder available in " + ghcompfolder + "?"
    ghenv.Component.AddRuntimeMessage(gh.Kernel.GH_RuntimeMessageLevel.Error, msg)


checkData = True

if not masterNode:
    checkData = False
    msg = "Input parameter masterNode failed to collect data"
    ghenv.Component.AddRuntimeMessage(gh.Kernel.GH_RuntimeMessageLevel.Warning, msg)

if not slaveNode:
    checkData = False
    msg = "Input parameter masterNode failed to collect data"
    ghenv.Component.AddRuntimeMessage(gh.Kernel.GH_RuntimeMessageLevel.Warning, msg)

if not dof_x or dof_y or dof_z or dof_xx or dof_yy or dof_zz:
    dof_x = True
    dof_y = True
    dof_z = True
    dof_xx = True
    dof_yy = True
    dof_zz = True

if checkData:
    Constraint = alpaca.EqualDOF(masterNode, slaveNode, dof_x, dof_y, dof_z, dof_xx, dof_yy, dof_zz)
# ---------- end python_15 ----------

# ----
# Trigonometric Time Series
python_16 = GhPythonScript(tStart=Slider(0, range=0..5), tEnd="10.00", period="3.00")  # -> timeSeries, Graph
# ---------- python_16: Python ----------
"""
Create a PointLoad
-
    Args:
        tStart:
        tEnd:
        period:
        factor:
        shift:
    Returns:
        timeSeries:
        Graph:
"""

import sys
import Rhino.Geometry as rg
import Grasshopper as gh
import copy
import math


## add alpaca install directory to system path

ghcompfolder = gh.Folders.DefaultAssemblyFolder
if ghcompfolder not in sys.path:
    sys.path.append(ghcompfolder)

try:
    from Alpaca4d import alpaca4d as alpaca
except:
    msg = "Cannot import Alpaca4d. Is the Alpaca4d folder available in " + ghcompfolder + "?"
    ghenv.Component.AddRuntimeMessage(gh.Kernel.GH_RuntimeMessageLevel.Error, msg)


def TrigonometricSeries(tStart, tEnd, period, shift, factor,t):
    if tStart <= t and t < tEnd:
        x = factor * math.sin( (2.0 * math.pi * (t - tStart))/period + shift)
        return x
    else:
        return 0

def linspace(a, b, n):
    if n < 2:
        return None
    diff = (float(b) - a)/(n - 1)
    return [diff * i + a  for i in range(n)]



checkData = True

if not tStart and not tStart == 0:
    checkData = False
    msg = "Input parameter tStart failed to collect data"
    ghenv.Component.AddRuntimeMessage(gh.Kernel.GH_RuntimeMessageLevel.Warning, msg)

if not tEnd and not tEnd == 0:
    checkData = False
    msg = "Input parameter tEnd failed to collect data"
    ghenv.Component.AddRuntimeMessage(gh.Kernel.GH_RuntimeMessageLevel.Warning, msg)

if not period:
    checkData = False
    msg = "Input parameter period failed to collect data"
    ghenv.Component.AddRuntimeMessage(gh.Kernel.GH_RuntimeMessageLevel.Warning, msg)

if not factor:
    factor = 1

if not shift:
    shift = 0

if checkData:
    timeSeries = alpaca.TimeSeriesTrigonometric(tStart, tEnd, period, factor, shift)

    Graph = []
    
    for t in linspace(0,tEnd*2,100):
        Graph.append(TrigonometricSeries(tStart, tEnd, period, shift, factor,t))
# ---------- end python_16 ----------
panel_19 = Panel(python_16.timeSeries)

graph = QuickGraph(python_16.Graph, SortOrder=0)

num = Number([-0.000450671, -0.000455154, -1.48413e-05, 0.000507632, 0.000437923, 0.000441503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])
lng = ListLength(List=num)
series = Series(Start=0, Step="0.01", Count=lng)

# ----
# Path TimeSeries
number_slider_3 = Slider(7, range=1..10)
python_17 = GhPythonScript(time=series, values=num, factor=number_slider_3)  # -> out, timeSeries, Graph; inputs time: list, values: list
# ---------- python_17: Python ----------
"""
Create a Time Series Path
-
    Args:
        time:
        values:
        factor:
    Returns:
        timeSeries:
        Graph:
"""

import sys
import Rhino.Geometry as rg
import Grasshopper as gh
import copy


## add alpaca install directory to system path

ghcompfolder = gh.Folders.DefaultAssemblyFolder
if ghcompfolder not in sys.path:
    sys.path.append(ghcompfolder)

try:
    from Alpaca4d import alpaca4d as alpaca
except:
    msg = "Cannot import Alpaca4d. Is the Alpaca4d folder available in " + ghcompfolder + "?"
    ghenv.Component.AddRuntimeMessage(gh.Kernel.GH_RuntimeMessageLevel.Error, msg)


checkData = True

if not time:
    checkData = False
    msg = "Input parameter time failed to collect data"
    ghenv.Component.AddRuntimeMessage(gh.Kernel.GH_RuntimeMessageLevel.Warning, msg)

if not values:
    checkData = False
    msg = "Input parameter values failed to collect data"
    ghenv.Component.AddRuntimeMessage(gh.Kernel.GH_RuntimeMessageLevel.Warning, msg)

if not factor:
    factor = 1


if checkData:
    timeSeries = alpaca.TimeSeriesPath(values, time, factor)
    Graph = [value * factor for value in values]
# ---------- end python_17 ----------

graph_2 = QuickGraph(python_17.Graph, SortOrder=0)

# ----
# PointLoad
panel_20 = Panel("-0.25")
vec = VectorXYZ(XComponent=panel_20, YComponent=0, ZComponent=0)  # -> Vector, Length
python_18 = GhPythonScript(Pos=demesh.Vertices, Force=vec.Vector, TimeSeries=python_17.timeSeries)  # -> out, PointLoad; inputs Pos: Point3d, Force: Vector3d, Moment: Vector3d
# ---------- python_18: Python ----------
"""
Create a PointLoad
-
    Args:
        Pos:
        Force:
        Moment:
        TimeSeries:
    Returns:
        PointLoad:
"""

import sys
import Rhino.Geometry as rg
import Grasshopper as gh
import copy


## add alpaca install directory to system path

ghcompfolder = gh.Folders.DefaultAssemblyFolder
if ghcompfolder not in sys.path:
    sys.path.append(ghcompfolder)

try:
    from Alpaca4d import alpaca4d as alpaca
except:
    msg = "Cannot import Alpaca4d. Is the Alpaca4d folder available in " + ghcompfolder + "?"
    ghenv.Component.AddRuntimeMessage(gh.Kernel.GH_RuntimeMessageLevel.Error, msg)


checkData = True

if not Pos:
    checkData = False
    msg = "Input parameter Pos failed to collect data"
    ghenv.Component.AddRuntimeMessage(gh.Kernel.GH_RuntimeMessageLevel.Warning, msg)

if not Force:
    Force = rg.Vector3d(0,0,0)

if not Moment:
    Moment = rg.Vector3d(0,0,0)

if not TimeSeries:
    checkData = False
    msg = "Input parameter TimeSeries failed to collect data"
    ghenv.Component.AddRuntimeMessage(gh.Kernel.GH_RuntimeMessageLevel.Warning, msg)


if checkData:
    PointLoad = alpaca.PointLoad(Pos, Force, Moment, TimeSeries)
# ---------- end python_18 ----------

# ----
# tcl
python_19 = GhPythonScript(
    Element=flatten(python_6.Shell),
    Support=flatten(python_3),
    Load=flatten(python_18.PointLoad),
    Constraint=flatten(python_7.RigidDiaphragm))  # -> out, model, uniquePoint; inputs Element: list, Support: list, Load: list, Constraint: list
# ---------- python_19: Python ----------
import os
from Alpaca4d import alpaca4d as alpaca
import ghpythonlib.treehelpers as th
import Rhino.Geometry as rg
import rhinoscriptsyntax as rs
from collections import defaultdict, OrderedDict
import copy
import time



FolderPath = rs.DocumentPath()
os.chdir(FolderPath)

# create the object model
model = alpaca.Model()


start = time.clock()
#subdivide element per type

for element in Element:
    if element.type == "Beam":
        model.beams.append(element)
    elif element.type == "Shell":
        model.shells.append(element)
    elif element.type == "Brick":
        model.bricks.append(element)

end = time.clock() - start

print("time to subdivide element {}".format(end))

# create a list of unique point
# need to add the rigid constraint

model.getuniquePoints(model.beams, model.shells, model.bricks, model.constraints)


end = time.clock() - end

print("time to get uniquepoints {}".format(end))

#############
# create node and assign to object
#############

if model.uniquePointsThreeNDF:
    model.py.append(alpaca.Model.write3nd_tcl())
    for point in model.uniquePointsThreeNDF:
        node = alpaca.Node(point)
        node.ndf = 3
        node.setNodeTag(model.cloudPoint)
        model.nodes.append( node )
    
        model.py.append(node.write_tcl())

if model.uniquePointsSixNDF:
    model.py.append(alpaca.Model.write6ndf_tcl())
    for point in model.uniquePointsSixNDF:
        node = alpaca.Node(point)
        node.ndf = 6
        node.setNodeTag(model.cloudPoint)
        model.nodes.append( node )
     
        model.py.append(node.write_tcl())



#a = model.sixNDFModel
#b = model.threeNDFModel

#################
# create supports
#################

for supportNode in Support:
    if model.uniquePointsThreeNDF.Contains(supportNode.Pos):
        supportNode.ndf = 3
        model.threeNDFModel.append(supportNode)
    elif model.uniquePointsSixNDF.Contains(supportNode.Pos):
        supportNode.ndf = 6
        model.sixNDFModel.append(supportNode)
    else:
        raise ValueError('I can not find the node at location {0}'.format(supportNode.Pos.ToString()))
    
    supportNode.setNodeTag(model.cloudPoint)
    model.supports.append(supportNode)
    model.py.append(supportNode.write_tcl())



####################
# create constraints
####################


for constraint in Constraint:
    constraint.setNodeTag(model.cloudPoint)
    model.constraints.append(constraint)


# write py file


# assign tag and node Index to element and shell
for index, element in enumerate(Element,1):
    element.setTopology(model.cloudPoint)
    element.eleTag = index
    # assign the same eleTag at the rest
    element.setTags()


## load

for item in Load:
    item.setNodeTag(model.cloudPoint)

for item in model.beams:
    model.py.append(item.write_tcl())

for item in model.shells:
    model.py.append(item.write_tcl())


for item in Constraint:
    model.py.append(item.write_tcl())


timeSeriesDict = alpaca.TimeSeries.getTimeSeries(Load)[1]

model.py.append(alpaca.PointLoad.write_tcl(timeSeriesDict))
# ---------- end python_19 ----------
data = Data(python_19.model)
python_20 = GhPythonScript(model=data, Analysis=python_8.Analysis)  # -> out, AnalysisModel, textFile
# ---------- python_20: Python ----------
from Alpaca4d import alpaca4d as alpaca
import Rhino.RhinoDoc
import Grasshopper as gh
import copy
import rhinoscriptsyntax as rs
import os
import time


FolderPath = rs.DocumentPath()
os.chdir(FolderPath)

outputFileName = 'openSeesModel'

for dirpath, dirnames, filenames in os.walk(FolderPath):
    for filename in filenames:
        if filename == outputFileName:
            file = os.path.join(dirpath,outputFileName)
            os.remove(file)


# create a copy

AnalysisModel = copy.copy(model)
AnalysisModel.py = list(AnalysisModel.py)

# generate Recorder and assign name
AnalysisModel.recorderName = "recorder" + ".mpco"

AnalysisModel.py.append(alpaca.TCLRecorder.mpco(AnalysisModel.recorderName, True,True,True,True,False,False,True,True,True,True))



AnalysisModel.py.append(Analysis.write_tcl())
#AnalysisModel.StaticAnalysis(numIncr)
AnalysisModel.py.append("wipe")


textFile = AnalysisModel.py

time_start = time.clock()

AnalysisModel.writeFile(outputFileName)

time_elapsed = (time.clock() - time_start)
print("Writing Time {}".format(time_elapsed))



time_start = time.clock()

a, msg = AnalysisModel.runOpensees('tcl')

time_elapsed = (time.clock() - time_start)
print("Analyses Time {}".format(time_elapsed))

#ghenv.Component.AddRuntimeMessage(gh.Kernel.GH_RuntimeMessageLevel.Error, msg)
# ---------- end python_20 ----------

int = Integer("0")
python_21 = GhPythonScript(AlpacaModel=python_20.AnalysisModel, History=Toggle(False), step=int)  # -> out, displacement, rotation, displacement_History, rotation_displacement_History; inputs History: Boolean, step: Int32
# ---------- python_21: Python ----------
"""
Create a support
-
    Args:
        AlpacaModel:
        step:
    Returns:
        displacement:
        rotation:
"""


import sys
import os
import System
from System.Drawing import Color


import clr
import clrtype
import Rhino.Geometry as rg
import rhinoscriptsyntax as rs
import Grasshopper as gh
import copy
import ghpythonlib.treehelpers as th



## add alpaca install directory to system path

ghcompfolder = gh.Folders.DefaultAssemblyFolder
if ghcompfolder not in sys.path:
    sys.path.append(ghcompfolder)

try:
    from Alpaca4d import alpaca4d as alpaca
except:
    msg = "Cannot import Alpaca4d. Is the Alpaca4d folder available in " + ghcompfolder + "?"
    ghenv.Component.AddRuntimeMessage(gh.Kernel.GH_RuntimeMessageLevel.Error, msg)



FolderPath = rs.DocumentPath()
os.chdir(FolderPath)

my_module_name = "Alpaca_StepReader" # replace this with something unique that doesn't collide with a real module!
my_module = sys.modules.setdefault(my_module_name, type(sys)(my_module_name))

hdfFilePath = os.path.join(ghcompfolder, "Alpaca4d\HDF5CSharp.dll")
clr.AddReferenceToFileAndPath(hdfFilePath)


from HDF5CSharp import Hdf5

try:
    Steps = my_module.Steps
except AttributeError:
    type_2d = type(System.Array.CreateInstance(float, 1, 1))

    class Steps(object):
        __metaclass__ = clrtype.ClrClass
        _clrfields = {"STEP_{}".format(i): type_2d for i in range(1000)} # it will work for model with less than 1000 steps

    my_module.Steps = Steps


numberOfPoints = len(AlpacaModel.uniquePoints) #

fileId = 0
try:
    fileId = Hdf5.OpenFile(AlpacaModel.recorderName, True)
    print(fileId)
    displacementResult = Hdf5.ReadObject[Steps](fileId, "/MODEL_STAGE[1]/RESULTS/ON_NODES/DISPLACEMENT/DATA")
    
    displacement = []
    
    for i in range(numberOfPoints):
        x = getattr(displacementResult, 'STEP_{}'.format(step))[i,0]
        y = getattr(displacementResult, 'STEP_{}'.format(step))[i,1]
        z = getattr(displacementResult, 'STEP_{}'.format(step))[i,2]
        displacement.append(rg.Vector3d(x,y,z))
    
    
    
    
    rotationResult = Hdf5.ReadObject[Steps](fileId, "/MODEL_STAGE[1]/RESULTS/ON_NODES/ROTATION/DATA")
    
    rotation = []
    
    
    for i in range(numberOfPoints):
        x = getattr(rotationResult, 'STEP_{}'.format(step))[i,0]
        y = getattr(rotationResult, 'STEP_{}'.format(step))[i,1]
        z = getattr(rotationResult, 'STEP_{}'.format(step))[i,2]
        rotation.append(rg.Vector3d(x,y,z))
    Hdf5.CloseFile(fileId)
except:
    if fileId >0:
        a = Hdf5.CloseFile(fileId)
        print(a)
        print("I have closed the file")



numberOfPoints = len(AlpacaModel.uniquePoints) #
if History:
    fileId = 0
    try:
        fileId = Hdf5.OpenFile(AlpacaModel.recorderName, True)
        print(fileId)
        displacementResult = Hdf5.ReadObject[Steps](fileId, "/MODEL_STAGE[1]/RESULTS/ON_NODES/DISPLACEMENT/DATA")
        
        displacement_History = []
        
        for i in range(numberOfPoints):
            dispTemp = []
            for n_step in range(500):
                x = getattr(displacementResult, 'STEP_{}'.format(n_step))[i,0]
                y = getattr(displacementResult, 'STEP_{}'.format(n_step))[i,1]
                z = getattr(displacementResult, 'STEP_{}'.format(n_step))[i,2]
                dispTemp.append(rg.Vector3d(x,y,z))
            
            displacement_History.append(dispTemp)
            
        Hdf5.CloseFile(fileId)
    except:
        Hdf5.CloseFile(fileId)


displacement_History = th.list_to_tree(displacement_History)
# ---------- end python_21 ----------
split = SplitTree(Data=simplify(python_21.displacement_History), Masks=flatten("{<30}"))  # -> Positive, Negative
data_2 = Data(split.Positive)
graph_3 = QuickGraph(data_2, SortOrder=0)

int_2 = Integer(python_9)
python_22 = GhPythonScript(AlpacaModel=python_20.AnalysisModel, step=int_2)  # -> out, displacement, rotation, displacement_History, rotation_displacement_History; inputs step: Int32
# ---------- python_22: Python ----------
"""
Create a support
-
    Args:
        AlpacaModel:
        step:
    Returns:
        displacement:
        rotation:
"""


import sys
import os
import System
from System.Drawing import Color


import clr
import clrtype
import Rhino.Geometry as rg
import rhinoscriptsyntax as rs
import Grasshopper as gh
import copy



## add alpaca install directory to system path

ghcompfolder = gh.Folders.DefaultAssemblyFolder
if ghcompfolder not in sys.path:
    sys.path.append(ghcompfolder)

try:
    from Alpaca4d import alpaca4d as alpaca
except:
    msg = "Cannot import Alpaca4d. Is the Alpaca4d folder available in " + ghcompfolder + "?"
    ghenv.Component.AddRuntimeMessage(gh.Kernel.GH_RuntimeMessageLevel.Error, msg)



FolderPath = rs.DocumentPath()
os.chdir(FolderPath)

my_module_name = "Alpaca_StepReader" # replace this with something unique that doesn't collide with a real module!
my_module = sys.modules.setdefault(my_module_name, type(sys)(my_module_name))

hdfFilePath = os.path.join(ghcompfolder, "Alpaca4d\HDF5CSharp.dll")
clr.AddReferenceToFileAndPath(hdfFilePath)


from HDF5CSharp import Hdf5

try:
    Steps = my_module.Steps
except AttributeError:
    type_2d = type(System.Array.CreateInstance(float, 1, 1))

    class Steps(object):
        __metaclass__ = clrtype.ClrClass
        _clrfields = {"STEP_{}".format(i): type_2d for i in range(1000)} # it will work for model with less than 1000 steps

    my_module.Steps = Steps


numberOfPoints = len(AlpacaModel.uniquePoints) #

fileId = 0
try:
    fileId = Hdf5.OpenFile(AlpacaModel.recorderName, True)
    print(fileId)
    displacementResult = Hdf5.ReadObject[Steps](fileId, "/MODEL_STAGE[1]/RESULTS/ON_NODES/DISPLACEMENT/DATA")
    
    displacement = []
    
    for i in range(numberOfPoints):
        x = getattr(displacementResult, 'STEP_{}'.format(step))[i,0]
        y = getattr(displacementResult, 'STEP_{}'.format(step))[i,1]
        z = getattr(displacementResult, 'STEP_{}'.format(step))[i,2]
        displacement.append(rg.Vector3d(x,y,z))
    
    
    
    
    rotationResult = Hdf5.ReadObject[Steps](fileId, "/MODEL_STAGE[1]/RESULTS/ON_NODES/ROTATION/DATA")
    
    rotation = []
    
    
    for i in range(numberOfPoints):
        x = getattr(rotationResult, 'STEP_{}'.format(step))[i,0]
        y = getattr(rotationResult, 'STEP_{}'.format(step))[i,1]
        z = getattr(rotationResult, 'STEP_{}'.format(step))[i,2]
        rotation.append(rg.Vector3d(x,y,z))
    Hdf5.CloseFile(fileId)
except:
    if fileId >0:
        a = Hdf5.CloseFile(fileId)
        print(a)
        print("I have closed the file")
# ---------- end python_22 ----------
devec = DeconstructVector(Vector=python_22.displacement)  # -> XComponent, YComponent, ZComponent
vlen = VectorLength(Vector=python_22.displacement)
panel_21 = Panel("0.03")
multiplication = Multiplication(A=python_22.displacement, B=Slider(10, range=1..10))
bnd_2 = Bounds(Numbers=vlen)
gradientlibrary = GradientLibrary(gradIndex=Slider(4, range=1..12))  # -> reverse(colors); inputs gradIndex: Int32
#   port colors: A series of colors to be plugged into the "Ladybug_Legend Parameters" component.
# ---------- gradientlibrary: Python ----------
"""
Preset of gradient colors perfect for Data Visualisation
    Inputs:
        gradIndex: An index refering to one of the following possible gradients:
            0 - Orignal Ladybug
            1 - Nuanced Ladybug
            2 - Multi-colored Ladybug
            3 - Ecotect
            4 - Thermal Comfort Percentage
            5 - Thermal Comfort Colors
            6 - Shade Benefit/Harm
            7 - Shade Harm
            8 - Shade Benefit
            9 - CFD Colors 1
            10 - Radiation Benefit
            11 - Gsa10 Colour
            12 - Gsa9 Colour
    Returns:
        customColors: A series of colors.
"""

ghenv.Component.Name = "Gradient Library"
ghenv.Component.NickName = 'GradientLibrary'
#ghenv.Component.Message = 'GradientLibrary\nWIP'

import scriptcontext as sc
import Grasshopper.Kernel as gh
import System

gradientLibrary = {
        0: [System.Drawing.Color.FromArgb(75, 107, 169), System.Drawing.Color.FromArgb(115, 147, 202), System.Drawing.Color.FromArgb(170, 200, 247), System.Drawing.Color.FromArgb(193, 213, 208), System.Drawing.Color.FromArgb(245, 239, 103), System.Drawing.Color.FromArgb(252, 230, 74), System.Drawing.Color.FromArgb(239, 156, 21), System.Drawing.Color.FromArgb(234, 123, 0), System.Drawing.Color.FromArgb(234, 74, 0), System.Drawing.Color.FromArgb(234, 38, 0)],
        1: [System.Drawing.Color.FromArgb(49,54,149), System.Drawing.Color.FromArgb(69,117,180), System.Drawing.Color.FromArgb(116,173,209), System.Drawing.Color.FromArgb(171,217,233), System.Drawing.Color.FromArgb(224,243,248), System.Drawing.Color.FromArgb(255,255,191), System.Drawing.Color.FromArgb(254,224,144), System.Drawing.Color.FromArgb(253,174,97), System.Drawing.Color.FromArgb(244,109,67), System.Drawing.Color.FromArgb(215,48,39), System.Drawing.Color.FromArgb(165,0,38)],
        2: [System.Drawing.Color.FromArgb(4,25,145), System.Drawing.Color.FromArgb(7,48,224), System.Drawing.Color.FromArgb(7,88,255), System.Drawing.Color.FromArgb(1,232,255), System.Drawing.Color.FromArgb(97,246,156), System.Drawing.Color.FromArgb(166,249,86), System.Drawing.Color.FromArgb(254,244,1), System.Drawing.Color.FromArgb(255,121,0), System.Drawing.Color.FromArgb(239,39,0), System.Drawing.Color.FromArgb(138,17,0)],
        3: [System.Drawing.Color.FromArgb(0,0,255), System.Drawing.Color.FromArgb(53,0,202), System.Drawing.Color.FromArgb(107,0,148), System.Drawing.Color.FromArgb(160,0,95), System.Drawing.Color.FromArgb(214,0,41), System.Drawing.Color.FromArgb(255,12,0), System.Drawing.Color.FromArgb(255,66,0), System.Drawing.Color.FromArgb(255,119,0), System.Drawing.Color.FromArgb(255,173,0), System.Drawing.Color.FromArgb(255,226,0), System.Drawing.Color.FromArgb(255,255,0)],
        4: [System.Drawing.Color.FromArgb(0,0,0), System.Drawing.Color.FromArgb(110,0,153), System.Drawing.Color.FromArgb(255,0,0), System.Drawing.Color.FromArgb(255,255,102), System.Drawing.Color.FromArgb(255,255,255)],
        5: [System.Drawing.Color.FromArgb(0,136,255), System.Drawing.Color.FromArgb(200,225,255), System.Drawing.Color.FromArgb(255,255,255), System.Drawing.Color.FromArgb(255,230,230), System.Drawing.Color.FromArgb(255,0,0)],
        6: [System.Drawing.Color.FromArgb(5,48,97), System.Drawing.Color.FromArgb(33,102,172), System.Drawing.Color.FromArgb(67,147,195), System.Drawing.Color.FromArgb(146,197,222), System.Drawing.Color.FromArgb(209,229,240), System.Drawing.Color.FromArgb(255,255,255), System.Drawing.Color.FromArgb(253,219,199), System.Drawing.Color.FromArgb(244,165,130), System.Drawing.Color.FromArgb(214,96,77), System.Drawing.Color.FromArgb(178,24,43), System.Drawing.Color.FromArgb(103,0,31)],
        7: [System.Drawing.Color.FromArgb(255,255,255), System.Drawing.Color.FromArgb(253,219,199), System.Drawing.Color.FromArgb(244,165,130), System.Drawing.Color.FromArgb(214,96,77), System.Drawing.Color.FromArgb(178,24,43), System.Drawing.Color.FromArgb(103,0,31)],
        8: [System.Drawing.Color.FromArgb(255,255,255), System.Drawing.Color.FromArgb(209,229,240), System.Drawing.Color.FromArgb(146,197,222), System.Drawing.Color.FromArgb(67,147,195), System.Drawing.Color.FromArgb(33,102,172), System.Drawing.Color.FromArgb(5,48,97)],
        9: [System.Drawing.Color.FromArgb(0,16,120), System.Drawing.Color.FromArgb(38,70,160), System.Drawing.Color.FromArgb(5,180,222), System.Drawing.Color.FromArgb(16,180,109), System.Drawing.Color.FromArgb(59,183,35), System.Drawing.Color.FromArgb(143,209,19), System.Drawing.Color.FromArgb(228,215,29), System.Drawing.Color.FromArgb(246,147,17), System.Drawing.Color.FromArgb(243,74,0), System.Drawing.Color.FromArgb(255,0,0)],
        10: [System.Drawing.Color.FromArgb(0,191,48), System.Drawing.Color.FromArgb(255,238,184), System.Drawing.Color.FromArgb(255,0,0)],
        11: [System.Drawing.Color.FromArgb(204,0,71), System.Drawing.Color.FromArgb(255,182,71), System.Drawing.Color.FromArgb(206,255,115), System.Drawing.Color.FromArgb(26,180, 214),System.Drawing.Color.FromArgb(0,0,207)],
        12: [System.Drawing.Color.FromArgb(255, 51, 51), System.Drawing.Color.FromArgb(255, 170, 51), System.Drawing.Color.FromArgb(255, 255, 51), System.Drawing.Color.FromArgb(170, 255, 125), System.Drawing.Color.FromArgb(51, 255, 231), System.Drawing.Color.FromArgb(51, 170, 255), System.Drawing.Color.FromArgb(51,51, 255)]}
colors = gradientLibrary[gradIndex]
# ---------- end gradientlibrary ----------
remap = RemapNumbers(Value=vlen, Source=bnd_2, Target="0.05 to 0.90")  # -> Mapped, Clipped
demesh_3 = DeconstructMesh(Mesh=mesh_3)  # -> Vertices, Faces, Colours, Normals
move = Move(Geometry=demesh_3.Vertices, Motion=multiplication)  # -> Geometry, Transform
twnthrucols = TweenThroughColors(
    Colors=gradientlibrary,
    Factor=remap.Mapped,
    Normalized=True,
    Equalized=False,
    Weighted=False,
    Degree=3,
    InterpolationType=0,
    Alpha=True)
conmesh = ConstructMesh(Vertices=move.Geometry, Faces=demesh_3.Faces, Colours=twnthrucols)

int_3 = Integer(python_9)
python_23 = GhPythonScript(AlpacaModel=python_20.AnalysisModel, step=int_3)  # -> out, Mesh, p11, p22, p12, m11, m22, m12, q1, q2; inputs step: Int32
# ---------- python_23: Python ----------
"""
Create a support
-
    Args:
        AlpacaModel:
        step:
    Returns:
        p11:
        p22:
        p12:
        m11:
        m22:
        m12:
        q1:
        q2:
"""


import sys
import os
import System
from System.Drawing import Color


import clr
import clrtype
import Rhino.Geometry as rg
import rhinoscriptsyntax as rs
import Grasshopper as gh
import copy
import ghpythonlib.treehelpers as th


## add alpaca install directory to system path

ghcompfolder = gh.Folders.DefaultAssemblyFolder
if ghcompfolder not in sys.path:
    sys.path.append(ghcompfolder)

try:
    from Alpaca4d import alpaca4d as alpaca
except:
    msg = "Cannot import Alpaca4d. Is the Alpaca4d folder available in " + ghcompfolder + "?"
    ghenv.Component.AddRuntimeMessage(gh.Kernel.GH_RuntimeMessageLevel.Error, msg)



FolderPath = rs.DocumentPath()
os.chdir(FolderPath)


# import costum modules to read the hdf5 file

my_module_name = "Alpaca_StepReader"
my_module = sys.modules.setdefault(my_module_name, type(sys)(my_module_name))

hdfFilePath = os.path.join(ghcompfolder, "Alpaca4d\HDF5CSharp.dll")
clr.AddReferenceToFileAndPath(hdfFilePath)

from HDF5CSharp import Hdf5

try:
    Steps = my_module.Steps
except AttributeError:
    type_2d = type(System.Array.CreateInstance(float, 1, 1))

    class Steps(object):
        __metaclass__ = clrtype.ClrClass
        _clrfields = {"STEP_{}".format(i): type_2d for i in range(1000)} # it will work for model with less than 1000 steps

    my_module.Steps = Steps



# read result

p11 = []
p22 = []
p12 = []

m11 = []
m22 = []
m12 = []

q1 = []
q2 = []



## to fix the issue about index of different type of object

fileId = 0
try:
    fileId = Hdf5.OpenFile(AlpacaModel.recorderName, True)
    print(fileId)
    
    
    for i,item in enumerate(AlpacaModel.shells):
        if item.elementType == 'ShellMITC4':
            stressResult = Hdf5.ReadObject[Steps](fileId, "/MODEL_STAGE[1]/RESULTS/ON_ELEMENTS/stresses/53-UnknownMovableObject[201:0:0]/DATA")
        elif item.elementType == 'ShellDKGT':
            stressResult = Hdf5.ReadObject[Steps](fileId, "/MODEL_STAGE[1]/RESULTS/ON_ELEMENTS/stresses/167-UnknownMovableObject[103:0:0]/DATA")
        
        p11_0 = getattr(stressResult, 'STEP_{}'.format(step))[i,0]
        p11_1 = getattr(stressResult, 'STEP_{}'.format(step))[i,8]
        p11_2 = getattr(stressResult, 'STEP_{}'.format(step))[i,16]
        p11_3 = getattr(stressResult, 'STEP_{}'.format(step))[i,24]
        
        p11.append([p11_0,p11_1,p11_2,p11_3])
        
        
        p22_0 = getattr(stressResult, 'STEP_{}'.format(step))[i,1]
        p22_1 = getattr(stressResult, 'STEP_{}'.format(step))[i,9]
        p22_2 = getattr(stressResult, 'STEP_{}'.format(step))[i,17]
        p22_3 = getattr(stressResult, 'STEP_{}'.format(step))[i,25]
        
        p22.append([p22_0,p22_1,p22_2,p22_3])
        
        
        p12_0 = getattr(stressResult, 'STEP_{}'.format(step))[i,2]
        p12_1 = getattr(stressResult, 'STEP_{}'.format(step))[i,10]
        p12_2 = getattr(stressResult, 'STEP_{}'.format(step))[i,18]
        p12_3 = getattr(stressResult, 'STEP_{}'.format(step))[i,26]
        
        p12.append([p12_0,p12_1,p12_2,p12_3])
        
        
        m11_0 = getattr(stressResult, 'STEP_{}'.format(step))[i,3]
        m11_1 = getattr(stressResult, 'STEP_{}'.format(step))[i,11]
        m11_2 = getattr(stressResult, 'STEP_{}'.format(step))[i,19]
        m11_3 = getattr(stressResult, 'STEP_{}'.format(step))[i,27]
        
        m11.append([m11_0,m11_1,m11_2,m11_3])
        
        
        m22_0 = getattr(stressResult, 'STEP_{}'.format(step))[i,4]
        m22_1 = getattr(stressResult, 'STEP_{}'.format(step))[i,12]
        m22_2 = getattr(stressResult, 'STEP_{}'.format(step))[i,20]
        m22_3 = getattr(stressResult, 'STEP_{}'.format(step))[i,28]
        
        m22.append([m22_0,m22_1,m22_2,m22_3])
        
        
        m12_0 = getattr(stressResult, 'STEP_{}'.format(step))[i,5]
        m12_1 = getattr(stressResult, 'STEP_{}'.format(step))[i,13]
        m12_2 = getattr(stressResult, 'STEP_{}'.format(step))[i,21]
        m12_3 = getattr(stressResult, 'STEP_{}'.format(step))[i,29]
        
        m12.append([m12_0,m12_1,m12_2,m12_3])
        
        
        q1_0 = getattr(stressResult, 'STEP_{}'.format(step))[i,6]
        q1_1 = getattr(stressResult, 'STEP_{}'.format(step))[i,14]
        q1_2 = getattr(stressResult, 'STEP_{}'.format(step))[i,22]
        q1_3 = getattr(stressResult, 'STEP_{}'.format(step))[i,30]
        
        q1.append([q1_0,q1_1,q1_2,q1_3])
        
        
        q2_0 = getattr(stressResult, 'STEP_{}'.format(step))[i,7]
        q2_1 = getattr(stressResult, 'STEP_{}'.format(step))[i,15]
        q2_2 = getattr(stressResult, 'STEP_{}'.format(step))[i,23]
        q2_3 = getattr(stressResult, 'STEP_{}'.format(step))[i,31]
        
        q2.append([q2_0,q2_1,q2_2,q2_3])
        
        
        
    Hdf5.CloseFile(fileId)
    
except:
    if fileId >0:
        a = Hdf5.CloseFile(fileId)
        print("I have closed the file")


Mesh = []
for item in AlpacaModel.shells:
    Mesh.append(item.Mesh)

p11 = th.list_to_tree(p11)
p22 = th.list_to_tree(p22)
p12 = th.list_to_tree(p12)

m11 = th.list_to_tree(m11)
m22 = th.list_to_tree(m22)
m12 = th.list_to_tree(m12)

q1 = th.list_to_tree(q1)
q2 = th.list_to_tree(q2)
# ---------- end python_23 ----------
number_slider_4 = Slider(0.01, range=0..0.5)
avr_2 = Average(Input=python_23.p22)  # -> flatten(ArithmeticMean)
bnd_3 = Bounds(Numbers=avr_2)
panel_22 = Panel(python_23.q1)
gradientlibrary_2 = GradientLibrary(gradIndex=11)  # -> reverse(colors); inputs gradIndex: Int32; same code as gradientlibrary
remap_2 = RemapNumbers(Value=avr_2, Source=bnd_3, Target=Domain(0, 1))  # -> Mapped, Clipped
demesh_4 = DeconstructMesh(Mesh=python_23.Mesh)  # -> Vertices, Faces, Colours, Normals
facen = FaceNormals(Mesh=python_23.Mesh)  # -> Centers, Normals
twnthrucols_2 = TweenThroughColors(
    Colors=gradientlibrary_2,
    Factor=remap_2.Mapped,
    Normalized=True,
    Equalized=False,
    Weighted=False,
    Degree=3,
    InterpolationType=0,
    Alpha=True)
pl = PlaneNormal(Origin=facen.Centers, ZAxis=facen.Normals)
item_4 = ListItem(List=demesh_4.Vertices, Index=0, Wrap=True)  # -> Item, Item1
mcol = MeshColours(Mesh=graft(python_23.Mesh), Colours=graft(twnthrucols_2))  # -> flatten(Mesh)
vec2pt = Vector2Pt(PointA=item_4.Item, PointB=item_4.Item1, Unitize=False)  # -> Vector, Length
mjoin_3 = MeshJoin(Meshes=mcol)
align = AlignPlane(Plane=pl, Direction=vec2pt.Vector)  # -> Plane, Angle
weldvertices_2 = MeshWeldVertices(Mesh=mjoin_3, Tolerance=0.01)  # -> RuntimeMessage, Mesh

int_4 = Integer(python_9)
python_24 = GhPythonScript(AlpacaModel=python_20.AnalysisModel, step=int_4)  # -> out, SupportPosition, ReactionForce, ReactionMoment; inputs step: Int32
# ---------- python_24: Python ----------
"""
Create a support
-
    Args:
        AlpacaModel:
        step:
    Returns:
        displacement:
        rotation:
"""


import sys
import os
import System
from System.Drawing import Color


import clr
import clrtype
import Rhino.Geometry as rg
import rhinoscriptsyntax as rs
import Grasshopper as gh
import copy



## add alpaca install directory to system path

ghcompfolder = gh.Folders.DefaultAssemblyFolder
if ghcompfolder not in sys.path:
    sys.path.append(ghcompfolder)

try:
    from Alpaca4d import alpaca4d as alpaca
except:
    msg = "Cannot import Alpaca4d. Is the Alpaca4d folder available in " + ghcompfolder + "?"
    ghenv.Component.AddRuntimeMessage(gh.Kernel.GH_RuntimeMessageLevel.Error, msg)



FolderPath = rs.DocumentPath()
os.chdir(FolderPath)

my_module_name = "Alpaca_StepReader" # replace this with something unique that doesn't collide with a real module!
my_module = sys.modules.setdefault(my_module_name, type(sys)(my_module_name))

hdfFilePath = os.path.join(ghcompfolder, "Alpaca4d\HDF5CSharp.dll")
clr.AddReferenceToFileAndPath(hdfFilePath)


from HDF5CSharp import Hdf5

try:
    Steps = my_module.Steps
except AttributeError:
    type_2d = type(System.Array.CreateInstance(float, 1, 1))

    class Steps(object):
        __metaclass__ = clrtype.ClrClass
        _clrfields = {"STEP_{}".format(i): type_2d for i in range(1000)} # it will work for model with less than 1000 steps

    my_module.Steps = Steps


supportTagLocation = [item.nodeTag - 1 for item in AlpacaModel.supports] #
print(supportTagLocation)

fileId = 0
try:
    fileId = Hdf5.OpenFile(AlpacaModel.recorderName, True)
    print(fileId)
    
    reactionForceResult = Hdf5.ReadObject[Steps](fileId, "/MODEL_STAGE[1]/RESULTS/ON_NODES/REACTION_FORCE/DATA")
    
    ReactionForce = []
    
    for i in supportTagLocation:
        print(i)
        x = getattr(reactionForceResult, 'STEP_{}'.format(step))[i,0]
        y = getattr(reactionForceResult, 'STEP_{}'.format(step))[i,1]
        z = getattr(reactionForceResult, 'STEP_{}'.format(step))[i,2]
        ReactionForce.append(rg.Vector3d(x,y,z))
    


    ReactionMomentResult = Hdf5.ReadObject[Steps](fileId, "/MODEL_STAGE[1]/RESULTS/ON_NODES/REACTION_MOMENT/DATA")
    
    ReactionMoment = []
    
    for i in supportTagLocation:
        print(i)
        x = getattr(ReactionMomentResult, 'STEP_{}'.format(step))[i,0]
        y = getattr(ReactionMomentResult, 'STEP_{}'.format(step))[i,1]
        z = getattr(ReactionMomentResult, 'STEP_{}'.format(step))[i,2]
        ReactionMoment.append(rg.Vector3d(x,y,z))
        
    Hdf5.CloseFile(fileId)
    
except:
    if fileId >0:
        a = Hdf5.CloseFile(fileId)
        print(a)
        print("I have closed the file")


SupportPosition = [item.Pos for item in AlpacaModel.supports]
# ---------- end python_24 ----------
division = Division(A=python_24.ReactionForce, B="5")
multiplication_2 = Multiplication(A=division, B=Slider(2, range=1..5))
vdisex = VectorDisplayEx(Point=python_24.SupportPosition, Vector=multiplication_2, Colour=ColourSwatch(SwatchColor=RGB(232, 0, 0)), Width=2)
