# Grasshopper definition Ex_Elements_Shell.gh (Grasshopper 1.0.7)
# plug-ins: MeshEdit Components, Kangaroo2 Components

# ---- group: Element
data = Data(0)
data_2 = Data(0)

# ---- group: Load
# instagram:    Alpaca4d
# facebook:     Alpaca4d
# mail:         alpaca4d@gmail.com
data_3 = Data(0)
data_4 = Data(0)

# ---- group: Cross-Section
data_5 = Data(0)
data_6 = Data(0)

# ---- group: Support
data_7 = Data(0)
data_8 = Data(0)

# ---- group: Material
data_9 = Data(0)
data_10 = Data(0)

# ---- group: Constraint
data_11 = Data(0)
data_12 = Data(0)

# ---- group: Material
division = Division(A="30000000", B=2)
num = Number("30000000")
eim = ElasticIsotropicMaterialAlpaca4d(E=num, G=division, rho="2500")  # -> out, nDMaterial
# ---------- eim: Python ----------
"""
Create a nD Elastic Isotropic Material
-
    Args:
        name:
        E:
        G:
        v:
        rho:
    Returns:
        nDMaterial:
"""

ghenv.Component.Name = "Elastic Isotropic Material (Alpaca4d)"
ghenv.Component.NickName = 'EIM'
ghenv.Component.Message = "Elastic Isotropic (Alpaca4d)"


import sys
import Rhino.Geometry as rg
import Grasshopper as gh
import copy


## add alpaca install directory to system path

ghcompfolder = gh.Folders.DefaultAssemblyFolder
if ghcompfolder not in sys.path:
    sys.path.append(ghcompfolder)

try:
    from Alpaca4d import alpaca4d as alpaca
except:
    msg = "Cannot import Alpaca4d. Is the Alpaca4d folder available in " + ghcompfolder + "?"
    ghenv.Component.AddRuntimeMessage(gh.Kernel.GH_RuntimeMessageLevel.Error, msg)


checkData = True

if not E:
    checkData = False
    msg = "Input parameter E failed to collect data"
    ghenv.Component.AddRuntimeMessage(gh.Kernel.GH_RuntimeMessageLevel.Warning, msg)

if not G and not v:
    checkData = False
    msg = "Input parameter G or v failed to collect data"
    ghenv.Component.AddRuntimeMessage(gh.Kernel.GH_RuntimeMessageLevel.Warning, msg)

if not rho:
    checkData = False
    msg = "Input parameter rho failed to collect data"
    ghenv.Component.AddRuntimeMessage(gh.Kernel.GH_RuntimeMessageLevel.Warning, msg)

if checkData:
    nDMaterial = alpaca.ElasticIsotropic(name, E, G, rho, v)
# ---------- end eim ----------

# ---- group: Cross-Section
pfs = PlateFiberAlpaca4d(thickness="0.1", nDMaterial=eim.nDMaterial)  # -> out, Section
# ---------- pfs: Python ----------
"""
Create a Plate Fiber Section
-
    Args:
        secName:
        thickness:
        nDMaterial:
    Returns:
        Section:
"""


import sys
import Rhino.Geometry as rg
import Grasshopper as gh
import copy

ghenv.Component.Name = "Plate Fiber (Alpaca4d)"
ghenv.Component.NickName = 'PFS'
ghenv.Component.Message = "Plate Fiber (Alpaca4d)"


## add alpaca install directory to system path

ghcompfolder = gh.Folders.DefaultAssemblyFolder
if ghcompfolder not in sys.path:
    sys.path.append(ghcompfolder)

try:
    from Alpaca4d import alpaca4d as alpaca
except:
    msg = "Cannot import Alpaca4d. Is the Alpaca4d folder available in " + ghcompfolder + "?"
    ghenv.Component.AddRuntimeMessage(gh.Kernel.GH_RuntimeMessageLevel.Error, msg)


checkData = True

if not thickness:
    checkData = False
    msg = "Input parameter thickness failed to collect data"
    ghenv.Component.AddRuntimeMessage(gh.Kernel.GH_RuntimeMessageLevel.Warning, msg)

if not nDMaterial:
    checkData = False
    msg = "Input parameter nDMaterial failed to collect data"
    ghenv.Component.AddRuntimeMessage(gh.Kernel.GH_RuntimeMessageLevel.Warning, msg)

if checkData:
    Section = alpaca.PlateFiberSection(secName, thickness, nDMaterial)
# ---------- end pfs ----------

# ---- group: Load
cts = ConstantTimeSeriesAlpaca4d()  # -> TimeSeries, Graph
# ---------- cts: Python ----------
"""
Create a Constant Time Series
-
    Args:
        tStart:
        tEnd:
        period:
        factor:
        shift:
    Returns:
        TimeSeries:
        Graph:
"""

ghenv.Component.Name = "Constant Time Series (Alpaca4d)"
ghenv.Component.NickName = 'CTS'
ghenv.Component.Message = "Constant Time Series (Alpaca4d)"


import sys
import Rhino.Geometry as rg
import Grasshopper as gh
import copy
import math


## add alpaca install directory to system path

ghcompfolder = gh.Folders.DefaultAssemblyFolder
if ghcompfolder not in sys.path:
    sys.path.append(ghcompfolder)

try:
    from Alpaca4d import alpaca4d as alpaca
except:
    msg = "Cannot import Alpaca4d. Is the Alpaca4d folder available in " + ghcompfolder + "?"
    ghenv.Component.AddRuntimeMessage(gh.Kernel.GH_RuntimeMessageLevel.Error, msg)

def ConstantSeries(x):
    return x



checkData = True

if not constantFactor:
    constantFactor = 1


if checkData:
    TimeSeries = alpaca.TimeSeriesConstant(constantFactor)
    
    Graph = []
    
    for x in range(10):
        Graph.append(ConstantSeries(constantFactor))
# ---------- end cts ----------
gl = GravityLoadAlpaca4d(GravityFactor=1, TimeSeries=cts.TimeSeries)  # -> out, Load
# ---------- gl: Python ----------
"""
Create Gravity Load
-
    Args:
        Pos:
        Force:
        Moment:
        TimeSeries:
    Returns:
        PointLoad:
"""

ghenv.Component.Name = "Gravity Load (Alpaca4d)"
ghenv.Component.NickName = 'GL'
ghenv.Component.Message = "Gravity Load (Alpaca4d)"



import sys
import Rhino.Geometry as rg
import Grasshopper as gh
import copy


## add alpaca install directory to system path

ghcompfolder = gh.Folders.DefaultAssemblyFolder
if ghcompfolder not in sys.path:
    sys.path.append(ghcompfolder)

try:
    from Alpaca4d import alpaca4d as alpaca
except:
    msg = "Cannot import Alpaca4d. Is the Alpaca4d folder available in " + ghcompfolder + "?"
    ghenv.Component.AddRuntimeMessage(gh.Kernel.GH_RuntimeMessageLevel.Error, msg)

if not TimeSeries:
    TimeSeries = alpaca.TimeSeriesConstant(1)

Load = alpaca.GravityLoad(GravityFactor, TimeSeries)
# ---------- end gl ----------

# ----
as = AnalysisSettingsAlpaca4d(Algorithm="krylovNewton", AnalysisSteps="1")  # -> Settings
# ---------- as: Python ----------
"""
Create Analysis settings
-
    Args:
        Constraint: 'Plain', 'Transformation'. Default is 'Transformation'.
        Numberer: 'RCM', 'AMD', 'Plain'. Default is 'RCM'.
        System: 'BandGen', 'BandSPD', 'ProfileSPD', 'SuperLU', 'UmfPack', 'FullGeneral', 'SparseSYM'. Default is 'BandSPD'.
        Test: Feature not implemented. Please contact alpaca4d@gmail.com 
        Algorithm: 'Linear', 'Newton', 'NewtonLineSearch', 'ModifiedNewton', 'KrylovNewton', 'SecantNewton', 'BFGS', 'Broyden'. Default is 'Linear'.
        Integrator: Default is LoadControl.
        AnalysisType: 'Static', 'Transient'. Default is 'Static'.
        AnalyesSteps:
    Returns:
        Analysis:
"""

import sys
import os


import clr
import clrtype
import Rhino.Geometry as rg
import rhinoscriptsyntax as rs
import Grasshopper as gh
import copy
import ghpythonlib.treehelpers as th


ghenv.Component.Name = "Analysis settings (Alpaca4d)"
ghenv.Component.NickName = 'AS'
ghenv.Component.Message = "Analysis settings \n(Alpaca4d)"



from Alpaca4d import alpaca4d as alpaca

checkData = True


# default Value
Constraint = 'Transformation' if Constraint is None else Constraint
ConstraintList = ['Plain', 'Transformation']

for item in ConstraintList:
    if Constraint.lower() == item.lower():
        print(item)
        Constraint = item


# default Value
Numberer = 'RCM' if Numberer is None else Numberer
NumbererList = ['RCM', 'AMD', 'Plain', 'ParallelPlain', 'ParallelRCM']

for i,item in enumerate(NumbererList):
    if Numberer.lower() == item.lower():
        Numberer = item



# default Value
System = 'BandSPD' if System is None else System
SystemList = ['BandGen', 'BandSPD', 'ProfileSPD', 'SuperLU', 'UmfPack', 'FullGeneral', 'SparseSYM']

for i,item in enumerate(SystemList):
    if System.lower() == item.lower():
        System = item


# default Test
Test = 'NormDispIncr 1.0e-6 12 5' if Test is None else Test




# default Value
Algorithm = 'Linear' if Algorithm is None else Algorithm
AlgorithmList = ['Linear', 'Newton', 'NewtonLineSearch', 'ModifiedNewton', 'KrylovNewton', 'SecantNewton', 'BFGS', 'Broyden']

for i,item in enumerate(AlgorithmList):
    if Algorithm.lower() == item.lower():
        Algorithm = item


# default Value
AnalysisType = 'Static' if AnalysisType is None else AnalysisType
AnalysisTypeList = ['Static', 'Transient']

for item in AnalysisTypeList:
    if AnalysisType.lower() == item.lower():
        AnalysisType = item


## Define Integrator
if AnalysisType == "Static":
    Integrator = "LoadControl 1.0" if Integrator is None else Integrator
elif AnalysisType == "Transien":
    Integrator = "Newmark 0.5 0.25" if Integrator is None else Integrator



if not AnalysisSteps:
    checkData = False
    msg = "Input parameter AnalysisSteps failed to collect data"
    ghenv.Component.AddRuntimeMessage(gh.Kernel.GH_RuntimeMessageLevel.Warning, msg)


if checkData:
    Settings = alpaca.Analysis(Constraint, Numberer,System,Test,Algorithm,Integrator,AnalysisType, AnalysisSteps)
    print(Settings.write_tcl())
# ---------- end as ----------

# ---- group: Model
mesh = Mesh(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)
refine = Refine(Mesh=mesh, Level="2")
deconstruct_mesh = DeconstructMesh(Mesh=refine)  # -> Vertices, Faces, Colours, Normals

# ----
duppt = RemoveDuplicatePts(Points=flatten(deconstruct_mesh.Vertices), Tolerance=0.01)

# ---- group: Model (continued)
deconstruct = Deconstruct(Point=duppt)  # -> XComponent, YComponent, ZComponent
equality = Equality(FirstNumber=deconstruct.ZComponent, SecondNumber="0")  # -> Equality, Inequality
dispatch = Dispatch(List=duppt, DispatchPattern=equality.Equality)  # -> ListA, ListB

# ----
tri = Triangulate(Mesh=refine)  # -> Mesh, Count

# ---- group: Support
toggle = BooleanToggle(True)
point = Point(dispatch.ListA)
support = SupportAlpaca4d(Pos=point, Tx=toggle, Ty=toggle, Tz=toggle, Rx=toggle, Ry=toggle, Rz=toggle)  # -> Support; inputs Pos: Point3d, Tx: Boolean, Ty: Boolean, Tz: Boolean, Rx: Boolean, Ry: Boolean, Rz: Boolean
# ---------- support: Python ----------
"""
Create a support
-
    Args:
        Pos:
        Tx:
        Ty:
        Tz:
        Rx:
        Ry:
    Returns:
        Support:
"""

ghenv.Component.Name = "Support (Alpaca4d)"
ghenv.Component.NickName = 'Support'
ghenv.Component.Message = "Support (Alpaca4d)"


import sys
import Rhino.Geometry as rg
import Grasshopper as gh


## add alpaca install directory to system path

ghcompfolder = gh.Folders.DefaultAssemblyFolder
if ghcompfolder not in sys.path:
    sys.path.append(ghcompfolder)

try:
    from Alpaca4d import alpaca4d as alpaca
except:
    msg = "Cannot import Alpaca4d. Is the Alpaca4d folder available in " + ghcompfolder + "?"
    ghenv.Component.AddRuntimeMessage(gh.Kernel.GH_RuntimeMessageLevel.Error, msg)

checkData = True


if not Pos:
    checkData = False
    msg = "Input parameter Pos failed to collect data"
    ghenv.Component.AddRuntimeMessage(gh.Kernel.GH_RuntimeMessageLevel.Warning, msg)

if checkData:
    Support = alpaca.Support(Pos, Tx, Ty, Tz, Rx, Ry, Rz)
# ---------- end support ----------

# ----
explode = MeshExplode(Mesh=tri.Mesh, Interpolate=False)

# ---- group: Element
mitc4 = ShellMITC4Alpaca4d(Mesh=explode, Section=pfs.Section, Colour=ColourSwatch(SwatchColor=RGB(0, 91, 237)))  # -> out, Element; inputs Mesh: Mesh, Colour: Color
# ---------- mitc4: Python ----------
"""
Create a ShellMITC4 element
-
    Args:
        Mesh:
        Section:
        Colour:
    Returns:
        Element:
"""

ghenv.Component.Name = "Shell MITC4 (Alpaca4d)"
ghenv.Component.NickName = 'MITC4'
ghenv.Component.Message = "ShellMITC4 (Alpaca4d)"



import sys
import Rhino.Geometry as rg
import Grasshopper as gh
import copy
from System.Drawing import Color


## add alpaca install directory to system path

ghcompfolder = gh.Folders.DefaultAssemblyFolder
if ghcompfolder not in sys.path:
    sys.path.append(ghcompfolder)

try:
    from Alpaca4d import alpaca4d as alpaca
except:
    msg = "Cannot import Alpaca4d. Is the Alpaca4d folder available in " + ghcompfolder + "?"
    ghenv.Component.AddRuntimeMessage(gh.Kernel.GH_RuntimeMessageLevel.Error, msg)


checkData = True

if not Mesh:
    checkData = False
    msg = "Input parameter Mesh failed to collect data"
    ghenv.Component.AddRuntimeMessage(gh.Kernel.GH_RuntimeMessageLevel.Warning, msg)

if not Section:
    checkData = False
    msg = "Input parameter Section failed to collect data"
    ghenv.Component.AddRuntimeMessage(gh.Kernel.GH_RuntimeMessageLevel.Warning, msg)

if not Colour:
    Colour = Color.Blue


if checkData:
    
    Mesh.Unweld(0,True)
    explodedMesh = Mesh.ExplodeAtUnweldedEdges()
    if explodedMesh.Length > 0:
        Element = []
        for mesh in explodedMesh:
            if mesh.Vertices.Count == 4:
                Element.append(alpaca.ShellMITC4(mesh, copy.deepcopy(Section), Colour))
            elif mesh.Vertices.Count == 3:
                Element.append(alpaca.ShellNLDKGT(mesh, copy.deepcopy(Section), Colour))
    elif explodedMesh.Length == 0:
        if Mesh.Vertices.Count == 4:
                Element = alpaca.ShellMITC4(Mesh, copy.deepcopy(Section), Colour)
        elif Mesh.Vertices.Count == 3:
            Element = alpaca.ShellNLDKGT(Mesh, copy.deepcopy(Section), Colour)
# ---------- end mitc4 ----------

# ----
am = AssembleModelAlpaca4d(Element=flatten(mitc4.Element), Support=flatten(support), Load=flatten(gl.Load))  # -> out, AlpacaModel, Mass; inputs Element: list, Support: list, Load: list, Constraint: list
# ---------- am: Python ----------
"""
Create a FEA Model
-
    Args:
        Element:
        Support:
        Load:
        Constraint:
    Returns:
        AlpacaModel:
"""


import os
import sys
import ghpythonlib.treehelpers as th
import Rhino.Geometry as rg
import Rhino.Collections as rc
import rhinoscriptsyntax as rs
from collections import defaultdict, OrderedDict
import copy
import time
import Grasshopper as gh


ghenv.Component.Name = "Assemble Model (Alpaca4d)"
ghenv.Component.NickName = 'AM'
ghenv.Component.Message = "Assemble Model (Alpaca4d)"


## add alpaca install directory to system path

ghcompfolder = gh.Folders.DefaultAssemblyFolder
if ghcompfolder not in sys.path:
    sys.path.append(ghcompfolder)

try:
    from Alpaca4d import alpaca4d as alpaca
except:
    msg = "Cannot import Alpaca4d. Is the Alpaca4d folder available in " + ghcompfolder + "?"
    ghenv.Component.AddRuntimeMessage(gh.Kernel.GH_RuntimeMessageLevel.Error, msg)


checkData = True

if not Element:
    checkData = False
    msg = "Input parameter Element failed to collect data"
    ghenv.Component.AddRuntimeMessage(gh.Kernel.GH_RuntimeMessageLevel.Warning, msg)

if not Support:
    checkData = False
    msg = "Input parameter Support failed to collect data"
    ghenv.Component.AddRuntimeMessage(gh.Kernel.GH_RuntimeMessageLevel.Warning, msg)


if checkData:
    
    FolderPath = rs.DocumentPath()
    os.chdir(FolderPath)
    
    # create the object model
    AlpacaModel = alpaca.Model()
    
    
    start = time.clock()
    #subdivide element per type
    
    for element in Element:
        if element.type == "Beam":
            AlpacaModel.beams.append(element)
        elif element.type == "Shell":
            AlpacaModel.shells.append(element)
        elif element.type == "Brick":
            AlpacaModel.bricks.append(element)
    
    end = time.clock() - start
    print("time to subdivide element {}".format(end))
    start = time.clock()
    
    # create a list of unique point
    # need to add the rigid constraint
    
    AlpacaModel.getuniquePoints(AlpacaModel.beams, AlpacaModel.shells, AlpacaModel.bricks, Constraint)
    
    
    end = time.clock() - start
    print("time to get uniquepoints {}".format(end))
    start = time.clock()
    
    
    #############
    # create node and assign to object
    #############
    
    if AlpacaModel.uniquePointsThreeNDF:
        AlpacaModel.py.append(alpaca.Model.write3ndf_tcl())
        for point in AlpacaModel.uniquePointsThreeNDF:
            node = alpaca.Node(point)
            node.ndf = 3
            node.setNodeTag(AlpacaModel)
            AlpacaModel.nodes.append( node )
        
            AlpacaModel.py.append(node.write_tcl())
    
    
    if AlpacaModel.uniquePointsSixNDF:
        AlpacaModel.py.append(alpaca.Model.write6ndf_tcl())
        for point in AlpacaModel.uniquePointsSixNDF:
            node = alpaca.Node(point)
            node.ndf = 6
            node.setNodeTag(AlpacaModel)
            AlpacaModel.nodes.append( node )
         
            AlpacaModel.py.append(node.write_tcl())
    
    
    
    end = time.clock() - start
    print("time to create node and assign tag {}".format(end))
    start = time.clock()
    
    
    #################
    # create supports
    #################
    
    for supportNode in Support:
        
        # if the list is empty, skip this operation
        if AlpacaModel.uniquePointsThreeNDF:
            closestPointInThreeNDF = rc.Point3dList.ClosestPointInList(AlpacaModel.uniquePointsThreeNDF, supportNode.Pos)
            if supportNode.Pos.DistanceTo(closestPointInThreeNDF) < 0.001:
                #print("I am in 3ndf")
                supportNode.ndf = 3
                AlpacaModel.threeNDFModel.append(supportNode)
                supportNode.setNodeTag(AlpacaModel)
        
        if AlpacaModel.uniquePointsSixNDF:
            closestPointInSixNDF = rc.Point3dList.ClosestPointInList(AlpacaModel.uniquePointsSixNDF, supportNode.Pos)
            if supportNode.Pos.DistanceTo(closestPointInSixNDF) < 0.001:
                supportNode.ndf = 6
                AlpacaModel.sixNDFModel.append(supportNode)
                supportNode.setNodeTag(AlpacaModel)
        
        
        AlpacaModel.supports.append(supportNode)
        AlpacaModel.py.append(supportNode.write_tcl())
    
    
    end = time.clock() - start
    print("time to create support and assign tag {}".format(end))
    start = time.clock()
    
    
    ####################
    # create constraints
    ####################
    
    
    for constraint in Constraint:
        constraint.setNodeTag(AlpacaModel)
        AlpacaModel.constraints.append(constraint)
    
    ####################
    # create equalDOF when the model has 3df and 6df together
    ####################
    
    
    end = time.clock() - start
    print("time to create constraint and assign tag {}".format(end))
    start = time.clock()
    
    
    Id = []
    IdB = []
    
    def SearchCallback(sender, e):
        Id.Add(e.Id)
        IdB.Add(e.IdB)
    
    
    
    lenThreeNDF = len(AlpacaModel.uniquePointsThreeNDF)
    lenSixNDF = len(AlpacaModel.uniquePointsSixNDF)
    
    
    if not(lenThreeNDF == 0 or lenSixNDF == 0):
        print("brick and beam together")
        rg.RTree.SearchOverlaps(AlpacaModel.RTreeCloudPointThreeNDF, AlpacaModel.RTreeCloudPointSixNDF, 0.001, SearchCallback)
        
        for i,j in zip(Id, IdB):
            print(i,j)
            node_i = AlpacaModel.uniquePointsThreeNDF[i]
            node_j = AlpacaModel.uniquePointsSixNDF[j]
            
            #index_i = AlpacaModel.cloudPoint.ClosestPoint(node_i) + 1
            #index_j = AlpacaModel.cloudPoint.ClosestPoint(node_j) + 1
            
            equalConstraint = alpaca.EqualDOF(node_i, node_j, True, True, True, False, False, False)
            equalConstraint.masterNodeTag = AlpacaModel.cloudPointThreeNDF.ClosestPoint(node_i) + 1
            equalConstraint.slaveNodesTag = AlpacaModel.cloudPointSixNDF.ClosestPoint(node_j) + 1 + len(AlpacaModel.uniquePointsThreeNDF)
            AlpacaModel.py.append(equalConstraint.write_tcl())
    
    
    
    end = time.clock() - start
    print("time to find common points between 3ndf and 6ndf {}".format(end))
    start = time.clock()
    
    
    # write py file
    
    
    # assign tag and node Index to element and shell
    for index, element in enumerate(Element,1):
        element.setTopologyRTree(AlpacaModel)
        element.eleTag = index
        element.setTags()
    
    
    
    end = time.clock() - start
    print("time to assign tags for the elements {}".format(end))
    start = time.clock()
    
    
    
    Mass = 0
    IsGravity = False
    
    for item in Load:
        if item.type == "Gravity Load":
            IsGravity = True
            GravityLoad = item
        if item.type == "PointLoad":
            AlpacaModel.loads.append(item)
    
    
    for item in Element:
        if item.type == "Beam":
            length = item.Crv.GetLength()
            Mass += (item.massDens * length)
            if IsGravity:
                gravityPointLoad = alpaca.PointLoad(item.Crv.PointAtStart, rg.Vector3d(0,0, -(item.massDens * length / 2)) * GravityLoad.GravityFactor, rg.Vector3d(0,0,0), GravityLoad.TimeSeries)
                #print( -(item.massDens * length / 2))
                AlpacaModel.loads.append(gravityPointLoad)
        if item.type == "Shell":
            meshArea = rg.AreaMassProperties.Compute(item.Mesh).Area
            areaDensity = item.CrossSection.thickness * item.CrossSection.material.rho
            Mass += areaDensity * meshArea
            if IsGravity:
                for vertex in item.Mesh.Vertices.ToPoint3dArray():
                    gravityPointLoad = alpaca.PointLoad(vertex, rg.Vector3d(0,0, -(areaDensity * meshArea/ len(item.Mesh.Vertices))) * GravityLoad.GravityFactor, rg.Vector3d(0,0,0), GravityLoad.TimeSeries)
                    AlpacaModel.loads.append(gravityPointLoad)
        if item.type == "Brick":
            #print(type(item.Mesh))
            meshVolume = rg.VolumeMassProperties.Compute(item.Mesh).Volume
            density = item.material.rho 
            Mass += density * meshVolume
            if IsGravity:
                for vertex in item.Mesh.Vertices.ToPoint3dArray():
                    gravityPointLoad = alpaca.PointLoad(vertex, rg.Vector3d(0,0, -(density * meshVolume / len(item.Mesh.Vertices))) * GravityLoad.GravityFactor, rg.Vector3d(0,0,0), GravityLoad.TimeSeries)
                    #print(len(item.Mesh.Vertices))
                    #print(density)
                    # volume can be zero if mesh faces are not properly rotated
                    #print(meshVolume)
                    #print(-(density * meshVolume / len(item.Mesh.Vertices)))
                    AlpacaModel.loads.append(gravityPointLoad)
    
    #print(AlpacaModel.loads)
    ## load
    
    
    for item in AlpacaModel.loads:
        item.setNodeTag(AlpacaModel)
    
    #print(AlpacaModel.loads)
    
    for item in AlpacaModel.beams:
        AlpacaModel.py.append(item.write_tcl())
    
    for item in AlpacaModel.shells:
        AlpacaModel.py.append(item.write_tcl())
    
    for item in AlpacaModel.bricks:
        AlpacaModel.py.append(item.write_tcl())
    
    
    for item in Constraint:
        AlpacaModel.py.append(item.write_tcl())
    
    
    timeSeriesDict = alpaca.TimeSeries.getTimeSeries(AlpacaModel.loads)[1]
    AlpacaModel.py.append(alpaca.PointLoad.write_tcl(timeSeriesDict,AlpacaModel))
# ---------- end am ----------
ra = RunAnalysisAlpaca4d(AlpacaModel=am.AlpacaModel, Settings=as)  # -> log, AlpacaSolvedModel
# ---------- ra: Python ----------
"""
Run an OpenSees Analysis
-
    Args:
        AlpacaModel:
        Settings:
    Returns:
        AlpacaSolvedModel:
"""



import Rhino.RhinoDoc
import Grasshopper as gh
import copy
import rhinoscriptsyntax as rs
import os
import time
import sys



ghenv.Component.Name = "Run Analysis (Alpaca4d)"
ghenv.Component.NickName = 'RA'
ghenv.Component.Message = "Run Analysis (Alpaca4d)"

ghcompfolder = gh.Folders.DefaultAssemblyFolder
if ghcompfolder not in sys.path:
    sys.path.append(ghcompfolder)

try:
    from Alpaca4d import alpaca4d as alpaca
except:
    msg = "Cannot import Alpaca4d. Is the Alpaca4d folder available in " + ghcompfolder + "?"
    ghenv.Component.AddRuntimeMessage(gh.Kernel.GH_RuntimeMessageLevel.Error, msg)


checkData = True



if not AlpacaModel:
    checkData = False
    msg = "Input parameter AlpacaModel failed to collect data"
    ghenv.Component.AddRuntimeMessage(gh.Kernel.GH_RuntimeMessageLevel.Warning, msg)


if not Settings:
    checkData = False
    msg = "Input parameter Settings failed to collect data"
    ghenv.Component.AddRuntimeMessage(gh.Kernel.GH_RuntimeMessageLevel.Warning, msg)


if checkData:
    FolderPath = rs.DocumentPath()
    os.chdir(FolderPath)
    
    outputFileName = 'openSeesModel'
    recorderFileName = 'recorder.mpco'
    
    for dirpath, dirnames, filenames in os.walk(FolderPath):
        for filename in filenames:
            if filename == outputFileName:
                file = os.path.join(dirpath,outputFileName)
                os.remove(file)
            elif filename == recorderFileName:
                file = os.path.join(dirpath,recorderFileName)
                os.remove(file)
    
    
    # create a copy
    
    AnalysisModel = copy.copy(AlpacaModel)
    AnalysisModel.py = list(AnalysisModel.py)
    
    # generate Recorder and assign name
    AnalysisModel.recorderName = "recorder" + ".mpco"
    
    AnalysisModel.py.append(alpaca.TCLRecorder.mpco(AnalysisModel.recorderName, True,True,True,True,False,False,True,True,True,True))
    
    
    AnalysisModel.analysis = Settings
    AnalysisModel.py.append(Settings.write_tcl())
    AnalysisModel.py.append("wipe")
    
    
    #textFile = AnalysisModel.py
    
    time_start = time.clock()
    
    AnalysisModel.writeFile(outputFileName)
    
    time_elapsed = (time.clock() - time_start)
    print("Writing Time {}".format(time_elapsed))
    
    
    
    time_start = time.clock()
    
    executable = os.path.join(ghcompfolder,'Alpaca4d\OpenSees-Solvers\opensees.bat')
    a, log = AnalysisModel.runOpensees(executable)
    
    
    time_elapsed = (time.clock() - time_start)
    print("Analyses Time {}".format(time_elapsed))
    
    AlpacaSolvedModel = copy.copy(AnalysisModel)
    AlpacaSolvedModel.isAnalysed = True
# ---------- end ra ----------
panel = Panel(ra.log)

data_13 = Data(ra.AlpacaSolvedModel)
rf = ReactionForcesAlpaca4d(AlpacaModel=data_13)  # -> out, SupportPosition, ReactionForce, ReactionMoment; inputs History: Boolean, step: Int32
# ---------- rf: Python ----------
"""
Read Reaction Forces
    Args:
        AlpacaModel:
        History:
        step:
    Returns:
        SupportPosition:
        ReactionForce:
        ReactionMoment:
        ReactionForce_History:
        ReactionMoment_History:
"""

ghenv.Component.Name = "Reaction Forces (Alpaca4d)"
ghenv.Component.NickName = 'RF'
ghenv.Component.Message = 'Reactions (Alpaca4d)'


import sys
import os
import System
from System.Drawing import Color


import clr
import clrtype
import Rhino.Geometry as rg
import rhinoscriptsyntax as rs
import Grasshopper as gh
import copy
import ghpythonlib.treehelpers as th



## add alpaca install directory to system path

ghcompfolder = gh.Folders.DefaultAssemblyFolder
if ghcompfolder not in sys.path:
    sys.path.append(ghcompfolder)

try:
    from Alpaca4d import alpaca4d as alpaca
except:
    msg = "Cannot import Alpaca4d. Is the Alpaca4d folder available in " + ghcompfolder + "?"
    ghenv.Component.AddRuntimeMessage(gh.Kernel.GH_RuntimeMessageLevel.Error, msg)



FolderPath = rs.DocumentPath()
os.chdir(FolderPath)

my_module_name = "Alpaca_StepReader" # replace this with something unique that doesn't collide with a real module!
my_module = sys.modules.setdefault(my_module_name, type(sys)(my_module_name))

hdfFilePath = os.path.join(ghcompfolder, "Alpaca4d\HDF5CSharp.dll")
clr.AddReferenceToFileAndPath(hdfFilePath)


from HDF5CSharp import Hdf5

try:
    Steps = my_module.Steps
except AttributeError:
    type_2d = type(System.Array.CreateInstance(float, 1, 1))

    class Steps(object):
        __metaclass__ = clrtype.ClrClass
        _clrfields = {"STEP_{}".format(i): type_2d for i in range(1000)} # it will work for model with less than 1000 steps

    my_module.Steps = Steps



checkData = True

if not AlpacaModel:
    checkData = False
    msg = "Input parameter AlpacaModel failed to collect data"
    ghenv.Component.AddRuntimeMessage(gh.Kernel.GH_RuntimeMessageLevel.Warning, msg)



History = False if History is None else History


if checkData:
    step = (int(AlpacaModel.analysis.NumberOfSteps) - 1) if step is None else step
    supportTagLocation = [item.nodeTag - 1 for item in AlpacaModel.supports] #
    
    if not History:
    
        try:
            fileId = Hdf5.OpenFile(AlpacaModel.recorderName, True)
            
            
            reactionForceResult = Hdf5.ReadObject[Steps](fileId, "/MODEL_STAGE[1]/RESULTS/ON_NODES/REACTION_FORCE/DATA")
            ReactionForce = []
            for i in supportTagLocation:
                x = getattr(reactionForceResult, 'STEP_{}'.format(step))[i,0]
                y = getattr(reactionForceResult, 'STEP_{}'.format(step))[i,1]
                z = getattr(reactionForceResult, 'STEP_{}'.format(step))[i,2]
                ReactionForce.append(rg.Vector3d(x,y,z))
            
            
            ReactionMomentResult = Hdf5.ReadObject[Steps](fileId, "/MODEL_STAGE[1]/RESULTS/ON_NODES/REACTION_MOMENT/DATA")
            ReactionMoment = []
            for i in supportTagLocation:
                x = getattr(ReactionMomentResult, 'STEP_{}'.format(step))[i,0]
                y = getattr(ReactionMomentResult, 'STEP_{}'.format(step))[i,1]
                z = getattr(ReactionMomentResult, 'STEP_{}'.format(step))[i,2]
                ReactionMoment.append(rg.Vector3d(x,y,z))
                
            Hdf5.CloseFile(fileId)
            
        except:
            if fileId >0:
                Hdf5.CloseFile(fileId)
                print("I have closed the file")
    
    
    if History:
        try:
            fileId = Hdf5.OpenFile(AlpacaModel.recorderName, True)
        
            maxNumberStep = int(AlpacaModel.analysis.NumberOfSteps)
            
            reactionForceResult = Hdf5.ReadObject[Steps](fileId, "/MODEL_STAGE[1]/RESULTS/ON_NODES/REACTION_FORCE/DATA")
            ReactionForce = []
            for i in supportTagLocation:
                reactionForceTemp = []
                for n_step in range(maxNumberStep):
                    x = getattr(reactionForceResult, 'STEP_{}'.format(n_step))[i,0]
                    y = getattr(reactionForceResult, 'STEP_{}'.format(n_step))[i,1]
                    z = getattr(reactionForceResult, 'STEP_{}'.format(n_step))[i,2]
                    reactionForceTemp.append(rg.Vector3d(x,y,z))
            
                ReactionForce.append(reactionForceTemp)
    
    
            reactionMomentResult = Hdf5.ReadObject[Steps](fileId, "/MODEL_STAGE[1]/RESULTS/ON_NODES/REACTION_MOMENT/DATA")
            ReactionMoment = []
            for i in supportTagLocation:
                reactionMomentTemp = []
                for n_step in range(maxNumberStep):
                    x = getattr(reactionMomentResult, 'STEP_{}'.format(n_step))[i,0]
                    y = getattr(reactionMomentResult, 'STEP_{}'.format(n_step))[i,1]
                    z = getattr(reactionMomentResult, 'STEP_{}'.format(n_step))[i,2]
                    reactionMomentTemp.append(rg.Vector3d(x,y,z))
            
                ReactionMoment.append(reactionMomentTemp)
            Hdf5.CloseFile(fileId)
            
        except:
            Hdf5.CloseFile(fileId)
    
    
    
    
    SupportPosition = [item.Pos for item in AlpacaModel.supports]
    ReactionForce = th.list_to_tree(ReactionForce)
    ReactionMoment = th.list_to_tree(ReactionMoment)
# ---------- end rf ----------
rf_2 = ReactionForcesAlpaca4d(AlpacaModel=data_13, History=Toggle(True))  # -> out, SupportPosition, ReactionForce, ReactionMoment; inputs History: Boolean, step: Int32; same code as rf
vdis = VectorDisplay(Anchor=rf.SupportPosition, Vector=rf.ReactionForce)
vdis_2 = VectorDisplay(Anchor=rf_2.SupportPosition, Vector=rf_2.ReactionForce)

data_14 = Data(ra.AlpacaSolvedModel)
nd = NodalDisplacementsAlpaca4d(AlpacaModel=data_14)  # -> out, displacement, rotation; inputs History: Boolean, step: Int32
# ---------- nd: Python ----------
"""
Read displacement results
-
    Args:
        AlpacaModel:
        History: True to visualise the displacement and rotation history of the points
        step:
    Returns:
        displacement:
        rotation:
        displacement_History:
        rotation_History:
"""

ghenv.Component.Name = "Nodal Displacements (Alpaca4d)"
ghenv.Component.NickName = 'ND'
ghenv.Component.Message = "Displacements (Alpaca4d)"

import sys
import os
import System
from System.Drawing import Color


import clr
import clrtype
import Rhino.Geometry as rg
import rhinoscriptsyntax as rs
import Grasshopper as gh
import copy
import ghpythonlib.treehelpers as th



## add alpaca install directory to system path

ghcompfolder = gh.Folders.DefaultAssemblyFolder
if ghcompfolder not in sys.path:
    sys.path.append(ghcompfolder)

try:
    from Alpaca4d import alpaca4d as alpaca
except:
    msg = "Cannot import Alpaca4d. Is the Alpaca4d folder available in " + ghcompfolder + "?"
    ghenv.Component.AddRuntimeMessage(gh.Kernel.GH_RuntimeMessageLevel.Error, msg)



FolderPath = rs.DocumentPath()
os.chdir(FolderPath)

my_module_name = "Alpaca_StepReader" # replace this with something unique that doesn't collide with a real module!
my_module = sys.modules.setdefault(my_module_name, type(sys)(my_module_name))

hdfFilePath = os.path.join(ghcompfolder, "Alpaca4d\HDF5CSharp.dll")
clr.AddReferenceToFileAndPath(hdfFilePath)


from HDF5CSharp import Hdf5

try:
    Steps = my_module.Steps
except AttributeError:
    type_2d = type(System.Array.CreateInstance(float, 1, 1))

    class Steps(object):
        __metaclass__ = clrtype.ClrClass
        _clrfields = {"STEP_{}".format(i): type_2d for i in range(1000)} # it will work for model with less than 1000 steps

    my_module.Steps = Steps



checkData = True

if not AlpacaModel:
    checkData = False
    msg = "Input parameter AlpacaModel failed to collect data"
    ghenv.Component.AddRuntimeMessage(gh.Kernel.GH_RuntimeMessageLevel.Warning, msg)



History = False if History is None else History


if checkData:
    step = (int(AlpacaModel.analysis.NumberOfSteps) - 1) if step is None else step
    numberOfPoints = len(AlpacaModel.uniquePoints) #
    
    if not History:
        try:
            fileId = Hdf5.OpenFile(AlpacaModel.recorderName, True)
            
            
            displacementResult = Hdf5.ReadObject[Steps](fileId, "/MODEL_STAGE[1]/RESULTS/ON_NODES/DISPLACEMENT/DATA")
            displacement = []
            for i in range(numberOfPoints):
                x = getattr(displacementResult, 'STEP_{}'.format(step))[i,0]
                y = getattr(displacementResult, 'STEP_{}'.format(step))[i,1]
                z = getattr(displacementResult, 'STEP_{}'.format(step))[i,2]
                displacement.append(rg.Vector3d(x,y,z))
            
            
            rotationResult = Hdf5.ReadObject[Steps](fileId, "/MODEL_STAGE[1]/RESULTS/ON_NODES/ROTATION/DATA")
            rotation = []
            for i in range(numberOfPoints):
                x = getattr(rotationResult, 'STEP_{}'.format(step))[i,0]
                y = getattr(rotationResult, 'STEP_{}'.format(step))[i,1]
                z = getattr(rotationResult, 'STEP_{}'.format(step))[i,2]
                rotation.append(rg.Vector3d(x,y,z))
                
                
            Hdf5.CloseFile(fileId)
            print("I have closed the file")
        except:
            if fileId >0:
                Hdf5.CloseFile(fileId)
                print("I have closed the file because of exception")
    
    
    
    if History:
        try:
            fileId = Hdf5.OpenFile(AlpacaModel.recorderName, True)
            
            displacementResult = Hdf5.ReadObject[Steps](fileId, "/MODEL_STAGE[1]/RESULTS/ON_NODES/DISPLACEMENT/DATA")
            displacement = []
            
            for i in range(numberOfPoints):
                dispTemp = []
                maxNumberStep = int(AlpacaModel.analysis.NumberOfSteps)
                for n_step in range(maxNumberStep):
                    x = getattr(displacementResult, 'STEP_{}'.format(n_step))[i,0]
                    y = getattr(displacementResult, 'STEP_{}'.format(n_step))[i,1]
                    z = getattr(displacementResult, 'STEP_{}'.format(n_step))[i,2]
                    dispTemp.append(rg.Vector3d(x,y,z))
                    
                
                displacement.append(dispTemp)
    
    
    
    
            rotationResult = Hdf5.ReadObject[Steps](fileId, "/MODEL_STAGE[1]/RESULTS/ON_NODES/ROTATION/DATA")
            
            rotation = []
            
            for i in range(numberOfPoints):
                rotationTemp = []
                for n_step in range(maxNumberStep):
                    x = getattr(rotationResult, 'STEP_{}'.format(n_step))[i,0]
                    y = getattr(rotationResult, 'STEP_{}'.format(n_step))[i,1]
                    z = getattr(rotationResult, 'STEP_{}'.format(n_step))[i,2]
                    rotationTemp.append(rg.Vector3d(x,y,z))
                
                rotation.append(rotationTemp)
                
            Hdf5.CloseFile(fileId)
        except:
            Hdf5.CloseFile(fileId)
    
    
    displacement = th.list_to_tree(displacement)
    rotation = th.list_to_tree(rotation)
# ---------- end nd ----------
nd_2 = NodalDisplacementsAlpaca4d(AlpacaModel=data_14, History=Toggle(True))  # -> out, simplify(displacement), rotation; inputs History: Boolean, step: Int32; same code as nd
panel_2 = Panel(nd.displacement)
panel_3 = Panel(nd_2.displacement)
branch = TreeBranch(Tree=panel_3, Path=Slider(45, range=0..294), MaintainPaths=True)
graph = QuickGraph(branch, SortOrder=0)

data_15 = Data(ra.AlpacaSolvedModel)
vss = ViewShellStressesAlpaca4d(AlpacaSolvedModel=data_15, stressType=Slider(0, range=0..10))  # -> Shell; inputs step: Int32, stressType: Int32, listColor: list of Color
# ---------- vss: Python ----------
"""
Read Shell Stresses
-
    Args:
        AlpacaSolvedModel:
        step:
        stressType: 0-p11, 1-p22, 2-p12, 3-m11, 4-m22, 5-m12, 6-q1, 7-q2
        listColor:
    Returns:
        Shell
"""

ghenv.Component.Name = "View Shell Stresses (Alpaca4d)"
ghenv.Component.NickName = 'VSS'
ghenv.Component.Message = "View Shell Stresses (Alpaca4d)"

import sys
import os
import System
from System.Drawing import Color


import clr
import clrtype
import Rhino.Geometry as rg
import rhinoscriptsyntax as rs
import Grasshopper as gh
import copy
import ghpythonlib.treehelpers as th
from ghpythonlib.components import Bounds
import math as mt


## add alpaca install directory to system path

ghcompfolder = gh.Folders.DefaultAssemblyFolder
if ghcompfolder not in sys.path:
    sys.path.append(ghcompfolder)

try:
    from Alpaca4d import alpaca4d as alpaca
    from Alpaca4d import alpaca4dView as alpacaView
except:
    msg = "Cannot import Alpaca4d. Is the Alpaca4d folder available in " + ghcompfolder + "?"
    ghenv.Component.AddRuntimeMessage(gh.Kernel.GH_RuntimeMessageLevel.Error, msg)



FolderPath = rs.DocumentPath()
os.chdir(FolderPath)


# import costum modules to read the hdf5 file

my_module_name = "Alpaca_StepReader"
my_module = sys.modules.setdefault(my_module_name, type(sys)(my_module_name))

hdfFilePath = os.path.join(ghcompfolder, "Alpaca4d\HDF5CSharp.dll")
clr.AddReferenceToFileAndPath(hdfFilePath)

from HDF5CSharp import Hdf5

try:
    Steps = my_module.Steps
except AttributeError:
    type_2d = type(System.Array.CreateInstance(float, 1, 1))

    class Steps(object):
        __metaclass__ = clrtype.ClrClass
        _clrfields = {"STEP_{}".format(i): type_2d for i in range(1000)} # it will work for model with less than 1000 steps

    my_module.Steps = Steps


checkData = True

if not AlpacaSolvedModel:
    checkData = False
    msg = "Input parameter AlpacaModel failed to collect data"
    ghenv.Component.AddRuntimeMessage(gh.Kernel.GH_RuntimeMessageLevel.Warning, msg)

if stressType is None:
    stressType = 0

if not listColor: listColor = [ System.Drawing.Color.DarkBlue, 
                                System.Drawing.Color.RoyalBlue, 
                                System.Drawing.Color.CornflowerBlue,
                                System.Drawing.Color.LightSkyBlue, 
                                System.Drawing.Color.LightBlue,
                                System.Drawing.Color.CadetBlue,
                                System.Drawing.Color.White,
                                System.Drawing.Color.Yellow,
                                System.Drawing.Color.Orange,
                                System.Drawing.Color.Red,
                                System.Drawing.Color.DarkRed]

if checkData:
    
    try:
        step = (int(AlpacaSolvedModel.analysis.NumberOfSteps) - 1) if step is None else step
        fileId = Hdf5.OpenFile(AlpacaSolvedModel.recorderName, True)
        
        shellSortedByeleTag = sorted(AlpacaSolvedModel.shells, key=lambda x: x.eleTag)
        
        ShellDKGT = []
        ShellMITC4 = []
        ASDShellQ4 = []
        
        
        for item in shellSortedByeleTag:
            if item.elementType == "ShellDKGT":
                ShellDKGT.append(item)
            elif item.elementType == "ShellMITC4":
                ShellMITC4.append(item)
            elif item.elementType == "ASDShellQ4":
                ASDShellQ4.append(item)
        
        shellElements = [ShellDKGT, ShellMITC4, ASDShellQ4]
        
        #shellMITC4
        stressResultMITC4 = Hdf5.ReadObject[Steps](fileId, "/MODEL_STAGE[1]/RESULTS/ON_ELEMENTS/stresses/53-UnknownMovableObject[201:0:0]/DATA")
        #ShellNLDKGT
        stressResultNLDKGT = Hdf5.ReadObject[Steps](fileId, "/MODEL_STAGE[1]/RESULTS/ON_ELEMENTS/stresses/167-UnknownMovableObject[103:0:0]/DATA")
        #asdea shell
        stressResultASDShellQ4 = Hdf5.ReadObject[Steps](fileId, "/MODEL_STAGE[1]/RESULTS/ON_ELEMENTS/stresses/203-UnknownMovableObject[201:0:0]/DATA")
        
        stress = []
        
        for j,stressResult in enumerate([stressResultNLDKGT, stressResultMITC4, stressResultASDShellQ4]):
            for i in range(len(shellElements[j])):
                p11_0 = getattr(stressResult, 'STEP_{}'.format(step))[i,0]
                p11_1 = getattr(stressResult, 'STEP_{}'.format(step))[i,8]
                p11_2 = getattr(stressResult, 'STEP_{}'.format(step))[i,16]
                p11_3 = getattr(stressResult, 'STEP_{}'.format(step))[i,24]
                
                p11 = [p11_0,p11_1,p11_2,p11_3]
                
                
                p22_0 = getattr(stressResult, 'STEP_{}'.format(step))[i,1]
                p22_1 = getattr(stressResult, 'STEP_{}'.format(step))[i,9]
                p22_2 = getattr(stressResult, 'STEP_{}'.format(step))[i,17]
                p22_3 = getattr(stressResult, 'STEP_{}'.format(step))[i,25]
                
                p22 = [p22_0,p22_1,p22_2,p22_3]
                
                
                p12_0 = getattr(stressResult, 'STEP_{}'.format(step))[i,2]
                p12_1 = getattr(stressResult, 'STEP_{}'.format(step))[i,10]
                p12_2 = getattr(stressResult, 'STEP_{}'.format(step))[i,18]
                p12_3 = getattr(stressResult, 'STEP_{}'.format(step))[i,26]
                
                p12 = [p12_0,p12_1,p12_2,p12_3]
                
                
                m11_0 = getattr(stressResult, 'STEP_{}'.format(step))[i,3]
                m11_1 = getattr(stressResult, 'STEP_{}'.format(step))[i,11]
                m11_2 = getattr(stressResult, 'STEP_{}'.format(step))[i,19]
                m11_3 = getattr(stressResult, 'STEP_{}'.format(step))[i,27]
                
                m11 = [m11_0,m11_1,m11_2,m11_3]
                
                
                m22_0 = getattr(stressResult, 'STEP_{}'.format(step))[i,4]
                m22_1 = getattr(stressResult, 'STEP_{}'.format(step))[i,12]
                m22_2 = getattr(stressResult, 'STEP_{}'.format(step))[i,20]
                m22_3 = getattr(stressResult, 'STEP_{}'.format(step))[i,28]
                
                m22 = [m22_0,m22_1,m22_2,m22_3]
                
                
                m12_0 = getattr(stressResult, 'STEP_{}'.format(step))[i,5]
                m12_1 = getattr(stressResult, 'STEP_{}'.format(step))[i,13]
                m12_2 = getattr(stressResult, 'STEP_{}'.format(step))[i,21]
                m12_3 = getattr(stressResult, 'STEP_{}'.format(step))[i,29]
                
                m12 = [m12_0,m12_1,m12_2,m12_3]
                
                
                q1_0 = getattr(stressResult, 'STEP_{}'.format(step))[i,6]
                q1_1 = getattr(stressResult, 'STEP_{}'.format(step))[i,14]
                q1_2 = getattr(stressResult, 'STEP_{}'.format(step))[i,22]
                q1_3 = getattr(stressResult, 'STEP_{}'.format(step))[i,30]
                
                q1 = [q1_0,q1_1,q1_2,q1_3]
                
                
                q2_0 = getattr(stressResult, 'STEP_{}'.format(step))[i,7]
                q2_1 = getattr(stressResult, 'STEP_{}'.format(step))[i,15]
                q2_2 = getattr(stressResult, 'STEP_{}'.format(step))[i,23]
                q2_3 = getattr(stressResult, 'STEP_{}'.format(step))[i,31]
                
                q2 = [q2_0,q2_1,q2_2,q2_3]
                
                stress.append([ p11, p22, p12, m11, m22, m12, q1, q2 ]) 
                
        Hdf5.CloseFile(fileId)
        print("I have close the file")
    except:
        Hdf5.CloseFile(fileId)
        print("I have close the file")


    ListValor = [ row[stressType] for row in stress ]
    ListFlatten = []
    for i in ListValor:
        for j in i:
            ListFlatten.append(j)
            
    bounds = Bounds(ListFlatten)
    shellElement = ShellDKGT + ShellMITC4 + ASDShellQ4
    Shell = alpacaView.ColorShellStress( shellElement, ListValor, bounds, listColor)
# ---------- end vss ----------
ss = ShellStressesAlpaca4d(AlpacaModel=data_15)  # -> out, p11, p22, p12, m11, m22, m12, q1, q2; inputs History: Boolean, step: Int32
# ---------- ss: Python ----------
"""
Read Shell Stresses
-
    Args:
        AlpacaModel:
        step:
    Returns:
        p11:
        p22:
        p12:
        m11:
        m22:
        m12:
        q1:
        q2:
"""

ghenv.Component.Name = "Shell Stresses (Alpaca4d)"
ghenv.Component.NickName = 'SS'
ghenv.Component.Message = "Shell Stresses (Alpaca4d)"

import sys
import os
import System
from System.Drawing import Color


import clr
import clrtype
import Rhino.Geometry as rg
import rhinoscriptsyntax as rs
import Grasshopper as gh
import copy
import ghpythonlib.treehelpers as th


## add alpaca install directory to system path

ghcompfolder = gh.Folders.DefaultAssemblyFolder
if ghcompfolder not in sys.path:
    sys.path.append(ghcompfolder)

try:
    from Alpaca4d import alpaca4d as alpaca
except:
    msg = "Cannot import Alpaca4d. Is the Alpaca4d folder available in " + ghcompfolder + "?"
    ghenv.Component.AddRuntimeMessage(gh.Kernel.GH_RuntimeMessageLevel.Error, msg)



FolderPath = rs.DocumentPath()
os.chdir(FolderPath)


# import costum modules to read the hdf5 file

my_module_name = "Alpaca_StepReader"
my_module = sys.modules.setdefault(my_module_name, type(sys)(my_module_name))

hdfFilePath = os.path.join(ghcompfolder, "Alpaca4d\HDF5CSharp.dll")
clr.AddReferenceToFileAndPath(hdfFilePath)

from HDF5CSharp import Hdf5

try:
    Steps = my_module.Steps
except AttributeError:
    type_2d = type(System.Array.CreateInstance(float, 1, 1))

    class Steps(object):
        __metaclass__ = clrtype.ClrClass
        _clrfields = {"STEP_{}".format(i): type_2d for i in range(1000)} # it will work for model with less than 1000 steps

    my_module.Steps = Steps


checkData = True

if not AlpacaModel:
    checkData = False
    msg = "Input parameter AlpacaModel failed to collect data"
    ghenv.Component.AddRuntimeMessage(gh.Kernel.GH_RuntimeMessageLevel.Warning, msg)

History = False if History is None else History



if checkData:
    
    step = (int(AlpacaModel.analysis.NumberOfSteps) - 1) if step is None else step
# read result
    
    p11 = []
    p22 = []
    p12 = []
    
    m11 = []
    m22 = []
    m12 = []
    
    q1 = []
    q2 = []
    
    
    
    ## to fix the issue about index of different type of object
    
    if History == False:
        try:
            fileId = Hdf5.OpenFile(AlpacaModel.recorderName, True)
            
            
            
            shellSortedByeleTag = sorted(AlpacaModel.shells, key=lambda x: x.eleTag)
            
            ShellDKGT = []
            ShellMITC4 = []
            ASDShellQ4 = []
            
            
            for item in shellSortedByeleTag:
                if item.elementType == "ShellDKGT":
                    ShellDKGT.append(item)
                elif item.elementType == "ShellMITC4":
                    ShellMITC4.append(item)
                elif item.elementType == "ASDShellQ4":
                    ASDShellQ4.append(item)
            
            shellElements = [ShellDKGT, ShellMITC4, ASDShellQ4]
            
            #shellMITC4
            stressResultMITC4 = Hdf5.ReadObject[Steps](fileId, "/MODEL_STAGE[1]/RESULTS/ON_ELEMENTS/stresses/53-UnknownMovableObject[201:0:0]/DATA")
            #ShellNLDKGT
            stressResultNLDKGT = Hdf5.ReadObject[Steps](fileId, "/MODEL_STAGE[1]/RESULTS/ON_ELEMENTS/stresses/167-UnknownMovableObject[103:0:0]/DATA")
            #asdea shell
            stressResultASDShellQ4 = Hdf5.ReadObject[Steps](fileId, "/MODEL_STAGE[1]/RESULTS/ON_ELEMENTS/stresses/203-UnknownMovableObject[201:0:0]/DATA")
            
            for j,stressResult in enumerate([stressResultNLDKGT, stressResultMITC4, stressResultASDShellQ4]):
                for i in range(len(shellElements[j])):
                    p11_0 = getattr(stressResult, 'STEP_{}'.format(step))[i,0]
                    p11_1 = getattr(stressResult, 'STEP_{}'.format(step))[i,8]
                    p11_2 = getattr(stressResult, 'STEP_{}'.format(step))[i,16]
                    p11_3 = getattr(stressResult, 'STEP_{}'.format(step))[i,24]
                    
                    p11.append([p11_0,p11_1,p11_2,p11_3])
                    
                    
                    
                    p22_0 = getattr(stressResult, 'STEP_{}'.format(step))[i,1]
                    p22_1 = getattr(stressResult, 'STEP_{}'.format(step))[i,9]
                    p22_2 = getattr(stressResult, 'STEP_{}'.format(step))[i,17]
                    p22_3 = getattr(stressResult, 'STEP_{}'.format(step))[i,25]
                    
                    p22.append([p22_0,p22_1,p22_2,p22_3])
                    
                    
                    p12_0 = getattr(stressResult, 'STEP_{}'.format(step))[i,2]
                    p12_1 = getattr(stressResult, 'STEP_{}'.format(step))[i,10]
                    p12_2 = getattr(stressResult, 'STEP_{}'.format(step))[i,18]
                    p12_3 = getattr(stressResult, 'STEP_{}'.format(step))[i,26]
                    
                    p12.append([p12_0,p12_1,p12_2,p12_3])
                    
                    
                    m11_0 = getattr(stressResult, 'STEP_{}'.format(step))[i,3]
                    m11_1 = getattr(stressResult, 'STEP_{}'.format(step))[i,11]
                    m11_2 = getattr(stressResult, 'STEP_{}'.format(step))[i,19]
                    m11_3 = getattr(stressResult, 'STEP_{}'.format(step))[i,27]
                    
                    m11.append([m11_0,m11_1,m11_2,m11_3])
                    
                    
                    m22_0 = getattr(stressResult, 'STEP_{}'.format(step))[i,4]
                    m22_1 = getattr(stressResult, 'STEP_{}'.format(step))[i,12]
                    m22_2 = getattr(stressResult, 'STEP_{}'.format(step))[i,20]
                    m22_3 = getattr(stressResult, 'STEP_{}'.format(step))[i,28]
                    
                    m22.append([m22_0,m22_1,m22_2,m22_3])
                    
                    
                    m12_0 = getattr(stressResult, 'STEP_{}'.format(step))[i,5]
                    m12_1 = getattr(stressResult, 'STEP_{}'.format(step))[i,13]
                    m12_2 = getattr(stressResult, 'STEP_{}'.format(step))[i,21]
                    m12_3 = getattr(stressResult, 'STEP_{}'.format(step))[i,29]
                    
                    m12.append([m12_0,m12_1,m12_2,m12_3])
                    
                    
                    q1_0 = getattr(stressResult, 'STEP_{}'.format(step))[i,6]
                    q1_1 = getattr(stressResult, 'STEP_{}'.format(step))[i,14]
                    q1_2 = getattr(stressResult, 'STEP_{}'.format(step))[i,22]
                    q1_3 = getattr(stressResult, 'STEP_{}'.format(step))[i,30]
                    
                    q1.append([q1_0,q1_1,q1_2,q1_3])
                    
                    
                    q2_0 = getattr(stressResult, 'STEP_{}'.format(step))[i,7]
                    q2_1 = getattr(stressResult, 'STEP_{}'.format(step))[i,15]
                    q2_2 = getattr(stressResult, 'STEP_{}'.format(step))[i,23]
                    q2_3 = getattr(stressResult, 'STEP_{}'.format(step))[i,31]
                    
                    q2.append([q2_0,q2_1,q2_2,q2_3])
                    
                    
                    
            Hdf5.CloseFile(fileId)
            print("I have close the file")
            
        except:
            Hdf5.CloseFile(fileId)
            print("I have close the file")
    
    
    elif History == True:
        try:
            fileId = Hdf5.OpenFile(AlpacaModel.recorderName, True)
        
            maxNumberStep = int(AlpacaModel.analysis.NumberOfSteps)
            shellSortedByeleTag = sorted(AlpacaModel.shells, key=lambda x: x.eleTag)
            
            ShellDKGT = []
            ShellMITC4 = []
            ASDShellQ4 = []
            
            
            for item in shellSortedByeleTag:
                if item.elementType == "ShellDKGT":
                    ShellDKGT.append(item)
                elif item.elementType == "ShellMITC4":
                    ShellMITC4.append(item)
                elif item.elementType == "ASDShellQ4":
                    ASDShellQ4.append(item)
            
            shellElements = [ShellDKGT, ShellMITC4, ASDShellQ4]
            
            #shellMITC4
            stressResultMITC4 = Hdf5.ReadObject[Steps](fileId, "/MODEL_STAGE[1]/RESULTS/ON_ELEMENTS/stresses/53-UnknownMovableObject[201:0:0]/DATA")
            #ShellNLDKGT
            stressResultNLDKGT = Hdf5.ReadObject[Steps](fileId, "/MODEL_STAGE[1]/RESULTS/ON_ELEMENTS/stresses/167-UnknownMovableObject[103:0:0]/DATA")
            #asdea shell
            stressResultASDShellQ4 = Hdf5.ReadObject[Steps](fileId, "/MODEL_STAGE[1]/RESULTS/ON_ELEMENTS/stresses/203-UnknownMovableObject[201:0:0]/DATA")
            
            
            
            for j,stressResult in enumerate([stressResultNLDKGT, stressResultMITC4, stressResultASDShellQ4]):
                for i in range(len(shellElements[j])):
                    p11Temp = []
                    p22Temp = []
                    p12Temp = []
                    
                    m11Temp = []
                    m22Temp = []
                    m12Temp = []
                    
                    q1Temp = []
                    q2Temp = []
                    
                    
                    for n_step in range(maxNumberStep):
                        p11_0 = getattr(stressResult, 'STEP_{}'.format(n_step))[i,0]
                        p11_1 = getattr(stressResult, 'STEP_{}'.format(n_step))[i,8]
                        p11_2 = getattr(stressResult, 'STEP_{}'.format(n_step))[i,16]
                        p11_3 = getattr(stressResult, 'STEP_{}'.format(n_step))[i,24]
                        
                        p11Temp.append([p11_0,p11_1,p11_2,p11_3])
                        
                        
                        
                        p22_0 = getattr(stressResult, 'STEP_{}'.format(n_step))[i,1]
                        p22_1 = getattr(stressResult, 'STEP_{}'.format(n_step))[i,9]
                        p22_2 = getattr(stressResult, 'STEP_{}'.format(n_step))[i,17]
                        p22_3 = getattr(stressResult, 'STEP_{}'.format(n_step))[i,25]
                        
                        p22Temp.append([p22_0,p22_1,p22_2,p22_3])
                        
                        
                        p12_0 = getattr(stressResult, 'STEP_{}'.format(n_step))[i,2]
                        p12_1 = getattr(stressResult, 'STEP_{}'.format(n_step))[i,10]
                        p12_2 = getattr(stressResult, 'STEP_{}'.format(n_step))[i,18]
                        p12_3 = getattr(stressResult, 'STEP_{}'.format(n_step))[i,26]
                        
                        p12Temp.append([p12_0,p12_1,p12_2,p12_3])
                        
                        
                        m11_0 = getattr(stressResult, 'STEP_{}'.format(n_step))[i,3]
                        m11_1 = getattr(stressResult, 'STEP_{}'.format(n_step))[i,11]
                        m11_2 = getattr(stressResult, 'STEP_{}'.format(n_step))[i,19]
                        m11_3 = getattr(stressResult, 'STEP_{}'.format(n_step))[i,27]
                        
                        m11Temp.append([m11_0,m11_1,m11_2,m11_3])
                        
                        
                        m22_0 = getattr(stressResult, 'STEP_{}'.format(n_step))[i,4]
                        m22_1 = getattr(stressResult, 'STEP_{}'.format(n_step))[i,12]
                        m22_2 = getattr(stressResult, 'STEP_{}'.format(n_step))[i,20]
                        m22_3 = getattr(stressResult, 'STEP_{}'.format(n_step))[i,28]
                        
                        m22Temp.append([m22_0,m22_1,m22_2,m22_3])
                        
                        
                        m12_0 = getattr(stressResult, 'STEP_{}'.format(n_step))[i,5]
                        m12_1 = getattr(stressResult, 'STEP_{}'.format(n_step))[i,13]
                        m12_2 = getattr(stressResult, 'STEP_{}'.format(n_step))[i,21]
                        m12_3 = getattr(stressResult, 'STEP_{}'.format(n_step))[i,29]
                        
                        m12Temp.append([m12_0,m12_1,m12_2,m12_3])
                        
                        
                        q1_0 = getattr(stressResult, 'STEP_{}'.format(n_step))[i,6]
                        q1_1 = getattr(stressResult, 'STEP_{}'.format(n_step))[i,14]
                        q1_2 = getattr(stressResult, 'STEP_{}'.format(n_step))[i,22]
                        q1_3 = getattr(stressResult, 'STEP_{}'.format(n_step))[i,30]
                        
                        q1Temp.append([q1_0,q1_1,q1_2,q1_3])
                        
                        
                        q2_0 = getattr(stressResult, 'STEP_{}'.format(n_step))[i,7]
                        q2_1 = getattr(stressResult, 'STEP_{}'.format(n_step))[i,15]
                        q2_2 = getattr(stressResult, 'STEP_{}'.format(n_step))[i,23]
                        q2_3 = getattr(stressResult, 'STEP_{}'.format(n_step))[i,31]
                        
                        q2Temp.append([q2_0,q2_1,q2_2,q2_3])
                    
                    p11.append(p11Temp)
                    p22.append(p22Temp)
                    p12.append(p12Temp)
                    
                    m11.append(m11Temp)
                    m22.append(m22Temp)
                    m12.append(m12Temp)
                    
                    q1.append(q1Temp)
                    q2.append(q2Temp)
            Hdf5.CloseFile(fileId)
            print("I have close the file")
        except:
            Hdf5.CloseFile(fileId)
            print("I have close the file")
    
    
    shellElementsFlat = []
    for sublist in shellElements:
        for item in sublist:
            shellElementsFlat.append(item.eleTag)
    
    
    
    
    
    p11 = [x for _,x in sorted(zip(shellElementsFlat, p11))]
    p22 = [x for _,x in sorted(zip(shellElementsFlat, p22))]
    p12 = [x for _,x in sorted(zip(shellElementsFlat, p12))]
    
    
    m11 = [x for _,x in sorted(zip(shellElementsFlat, m11))]
    m22 = [x for _,x in sorted(zip(shellElementsFlat, m22))]
    m12 = [x for _,x in sorted(zip(shellElementsFlat, m12))]
    
    
    q1 = [x for _,x in sorted(zip(shellElementsFlat, q1))]
    q2 = [x for _,x in sorted(zip(shellElementsFlat, q2))]
    
    
    
    p11 = th.list_to_tree(p11)
    p22 = th.list_to_tree(p22)
    p12 = th.list_to_tree(p12)
    
    m11 = th.list_to_tree(m11)
    m22 = th.list_to_tree(m22)
    m12 = th.list_to_tree(m12)
    
    q1 = th.list_to_tree(q1)
    q2 = th.list_to_tree(q2)
# ---------- end ss ----------
panel_4 = Panel(ss.p11)

dm = DeformedModelAlpaca4d(AlpacaSolvedModel=ra.AlpacaSolvedModel, scale="0.001", extrudeModel=Toggle(False))  # -> DefModel, bounds; inputs step: Int32, extrudeModel: Boolean, typeColor: Int32, listColor: list of Color
# ---------- dm: Python ----------
"""View Deformed model
    Args:
        AlpacaSolvedModel: Output of Analyses solver
        step:
        scale: Multiplication factor for displacement
        extrudeModel:  
True : view extruded model
else : view stick model
        typeColor:  View relative color of the traslation
<=0 : view traslation X 
1 : view traslation Y
2 : view traslation Z
>= 3 : view resulting displacement.
        listColor : one list of color 

    Output:
       DefModel: view deformed model
       bounds: max end min of displacement of the structure 
"""

ghenv.Component.Name = "Deformed Model (Alpaca4d)"
ghenv.Component.NickName = 'DM'
ghenv.Component.Message = "Deformed Model (Alpaca4d)"

from ghpythonlib.componentbase import executingcomponent as component
import System
import rhinoscriptsyntax as rs

import sys
import os
import clr
import clrtype
import Rhino.Geometry as rg
import Rhino as rc
import math as mt
import Grasshopper as gh
import ghpythonlib.treehelpers as th
from ghpythonlib.components import ConstructDomain

ghcompfolder = gh.Folders.DefaultAssemblyFolder
if ghcompfolder not in sys.path:
    sys.path.append(ghcompfolder)
try:
    from Alpaca4d import alpaca4dView as alpacaView
except:
    msg = "Cannot import Alpaca4d. Is the Alpaca4d folder available in " + ghcompfolder + "?"
    ghenv.Component.AddRuntimeMessage(gh.Kernel.GH_RuntimeMessageLevel.Error, msg)
    
FolderPath = rs.DocumentPath()
os.chdir(FolderPath)

ghcompfolder = gh.Folders.DefaultAssemblyFolder
my_module_name = "Alpaca_StepReader"
my_module = sys.modules.setdefault(my_module_name, type(sys)(my_module_name))


try:
    Steps = my_module.Steps
    Modes = my_module.Modes
except AttributeError:
    type_2d = type(System.Array.CreateInstance(float, 1, 1))

    class Steps(object):
        __metaclass__ = clrtype.ClrClass
        _clrfields = {"STEP_{}".format(i): type_2d for i in range(1000)} # it will work for model with less than 1000 steps

    class Modes(object):
        __metaclass__ = clrtype.ClrClass
        _clrfields = {"MODE_{}".format(i): type_2d for i in range(1000)} # it will work for model with less than 1000 steps

    my_module.Steps = Steps
    my_module.Modes = Modes


hdfFilePath = os.path.join(ghcompfolder, "Alpaca4d\HDF5CSharp.dll")
clr.AddReferenceToFileAndPath(hdfFilePath)

from HDF5CSharp import Hdf5

class MyComponent(component):
    
    def RunScript(self, AlpacaSolvedModel, step = None, scale = None , extrudeModel = None, typeColor = None, listColor = [] ):
        import sys
        
        self.extrudeModel = extrudeModel
        
        self.defModel1 = []
        self.defModel2 = []
        self.defModel3 = []
        
        self.beamColor = []
        

        if step == None:
            step = 0
        if extrudeModel == None:
            extrudeModel = False
        if typeColor == None:
            typeColor = 3
        
        if not listColor: listColor = [ System.Drawing.Color.DarkViolet, 
                                        System.Drawing.Color.BlueViolet, 
                                        System.Drawing.Color.RoyalBlue, 
                                        System.Drawing.Color.CornflowerBlue,
                                        System.Drawing.Color.LightSkyBlue, 
                                        System.Drawing.Color.LightBlue,
                                        System.Drawing.Color.CadetBlue,
                                        System.Drawing.Color.LightGreen,
                                        System.Drawing.Color.GreenYellow,
                                        System.Drawing.Color.Yellow,
                                        System.Drawing.Color.Orange,
                                        System.Drawing.Color.Red,
                                        System.Drawing.Color.DarkRed]
            
        checkData = True
        
        if not AlpacaSolvedModel:
            checkData = False
            msg = "Input parameter AlpacaSolvedModel failed to collect data"
            ghenv.Component.AddRuntimeMessage(gh.Kernel.GH_RuntimeMessageLevel.Warning, msg)
        else:
            try:
                fileId = Hdf5.OpenFile(AlpacaSolvedModel.recorderName, True)
                print( AlpacaSolvedModel.recorderName)
                numberOfPoints = len(AlpacaSolvedModel.uniquePoints) #
                
                displacement = []
                rotation = []
                dispNodeList = []
                
                if AlpacaSolvedModel.isModal == True:
                    print( AlpacaSolvedModel.isModal == True )
                    outputData = "MODEL_STAGE[1]/RESULTS/ON_NODES/MODES_OF_VIBRATION(U)/DATA/STEP_0"
                    print( outputData )
                    displacementResult = Hdf5.ReadObject[Modes](fileId, outputData)
                    for i in range(numberOfPoints):
                        tag = i + 1
                        vx = getattr(displacementResult, 'MODE_{}'.format(step))[i,0]
                        vy = getattr(displacementResult, 'MODE_{}'.format(step))[i,1]
                        vz = getattr(displacementResult, 'MODE_{}'.format(step))[i,2]
                        trasl = rg.Vector3d(vx,vy,vz)
                        displacement.append(trasl)
                        dispNodeList.append( [tag, trasl] )
                        
                    Hdf5.CloseFile(fileId)
                    print("I have closed the file")
                else: 
                    outputData = "/MODEL_STAGE[1]/RESULTS/ON_NODES/DISPLACEMENT/DATA"
                    print( outputData )
                    displacementResult = Hdf5.ReadObject[Steps](fileId, outputData)
                    for i in range(numberOfPoints):
                        tag = i + 1
                        vx = getattr(displacementResult, 'STEP_{}'.format(step))[i,0]
                        vy = getattr(displacementResult, 'STEP_{}'.format(step))[i,1]
                        vz = getattr(displacementResult, 'STEP_{}'.format(step))[i,2]
                        trasl = rg.Vector3d(vx,vy,vz)
                        displacement.append(trasl)
                        dispNodeList.append( [tag, trasl] )
                        
                    Hdf5.CloseFile(fileId)
                    print("I have closed the file")
            
                dispNodeDict = dict( dispNodeList )
                #---------------------------------------------------#
                defEleVector1 = alpacaView.BeamVectorDef(AlpacaSolvedModel,dispNodeDict) #beam
                defEleVector2 = alpacaView.ShellVectorDef(AlpacaSolvedModel,dispNodeDict) #shell
                defEleVector3 = alpacaView.BrickVectorDef(AlpacaSolvedModel,dispNodeDict) #shell
                bound = alpacaView.boundsDef(displacement, typeColor)
                if scale == None: scale = 1/bound[1]
                if self.extrudeModel == None or self.extrudeModel == False:
                    #BEAM
                    defModel1 = alpacaView.BeamDef(AlpacaSolvedModel, dispNodeDict,scale)
                    self.defModel1, self.beamColor = alpacaView.ColorBeamDef( defModel1, defEleVector1, bound, listColor, typeColor)
                    #SHELL
                    defModel2 = alpacaView.ShellDef(AlpacaSolvedModel,dispNodeDict,scale)
                    #BRICK
                    defModel3 = alpacaView.BrickDef(AlpacaSolvedModel,dispNodeDict,scale)
                else:
                    #BEAM
                    defModel1 = alpacaView.BeamDefExtrude(AlpacaSolvedModel, dispNodeDict,scale)
                    self.defModel1 = alpacaView.ColorBeamDefExtrude( defModel1, defEleVector1, bound, listColor, typeColor)
                    #SHELL
                    defModel2 = alpacaView.ShellDefExtrude(AlpacaSolvedModel,dispNodeDict,scale)
                    #BRICK
                    defModel3 = alpacaView.BrickDef(AlpacaSolvedModel,dispNodeDict,scale)
                    
                #SHELL COLOR
                self.defModel2 = alpacaView.ColorShellDef( defModel2, defEleVector2 , bound, listColor, typeColor, extrudeModel )
                #BRICK COLOR
                self.defModel3 = alpacaView.ColorBrickDef( defModel3, defEleVector3 , bound, listColor, typeColor)
                DefModel = th.list_to_tree(self.defModel1 + defModel2 + defModel3)
                bounds = ConstructDomain(bound[0], bound[1])
                return (DefModel, bounds)
            except:
                Hdf5.CloseFile(fileId)
                print("I have closed the file due to exception")
            # return outputs if you have them; here I try it for you:
        
        
    def DrawViewportWires(self,arg):
        for iMesh in self.defModel2 :
            colorWirframe = System.Drawing.Color.Black
            arg.Display.DrawMeshWires(iMesh, colorWirframe)
            
        for iMesh in self.defModel3 :
            colorWirframe = System.Drawing.Color.Black
            arg.Display.DrawMeshWires(iMesh, colorWirframe)
        if self.extrudeModel is None or self.extrudeModel is False:
            thickness =2
            for iBeam, iColor in zip(self.defModel1, self.beamColor) :
                for jBeam, jColor in zip(iBeam, iColor):
                    arg.Display.DrawCurve(jBeam, jColor, thickness)
        else:
            for iBeam in self.defModel1 :
                colorWirframe = System.Drawing.Color.Black
                arg.Display.DrawMeshWires(iBeam, colorWirframe)
# ---------- end dm ----------
