# Grasshopper definition shellMITC_NLGT_Test.gh (Grasshopper 1.0.7)
# plug-ins: MeshEdit Components, Kangaroo Components, karambaGH

# Format Engineers CAD Information Issue Disclaimer
# 
# Project: PROJECT NAME
# 
# You should use this model for reference purposes only to assist in co-ordinating your work and is supplementary to formally issued drawings. Once the data is introduced into your own CAD or other system Format Engineers Ltd. can take no responsibility for its accuracy.
# 
# The last set of formally issued paper drawings are the contractual documents which represent the current stage of design development. If you have any queries, please contact the project CAD co-ordinator or the CAD Development Team.
# 
# Changes:
# 
# YYYY-MM-DD: Summary of changes
# 
# Usage notes:
# 
# This definition includes a basic implementation of Merbarki's Farthest Point Seeding algorithm (2005), adapted for tracing lines of principal curvature on NURBS surfaces. Requires modified Triangle.NET, if this isn't attached then... good luck! There are currently two main limitations: (a) this implementation measures density in parameter space, and (b) it doesn't include the dynamic refinement of density that Mebarki suggests.
mesh = Mesh([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])
explode = MeshExplode(Mesh=mesh, Interpolate=False)  # -> flatten(Faces)
split = SplitList(List=flatten(explode), Index="100")  # -> ListA, ListB
tri = Triangulate(Mesh=split.ListB)  # -> Mesh, Count
merge = Merge(Data1=split.ListA, Data2=tri.Mesh)
jitter = Jitter(List=merge, Jitter=1, Seed=2)  # -> Values, Indices
clean = CombineClean(Meshes=flatten(jitter.Values))
demesh = DeconstructMesh(Mesh=clean)  # -> Vertices, Faces, Colours, Normals

pt = Point(demesh.Vertices)
pdecon = Deconstruct(Point=pt)  # -> XComponent, YComponent, ZComponent
bnd = Bounds(Numbers=pdecon.ZComponent)
dedomain = DeconstructDomain(Domain=bnd)  # -> Start, End
addition = Addition(A="0.01", B=dedomain.Start)
smaller = SmallerThan(FirstNumber=pdecon.ZComponent, SecondNumber=addition)  # -> SmallerThan, OrEqualTo
cull = CullPattern(List=pt, CullPattern=smaller.SmallerThan)
rdpoints = RemoveDuplicatePointsKaramba3D(Point=cull, LimitDistance=0.005)  # -> OutPoint, Info, Indexes

eim = ElasticIsotropicMaterialAlpaca4d(E="30000000", G="12500000", rho="2500")  # -> out, nDMaterial
# ---------- eim: Python ----------
"""
Create a nD Elastic Isotropic Material
-
    Args:
        name:
        E:
        G:
        v:
        rho:
    Returns:
        nDMaterial:
"""

ghenv.Component.Name = "Elastic Isotropic Material (Alpaca4d)"
ghenv.Component.NickName = 'EIM'
ghenv.Component.Message = "Elastic Isotropic (Alpaca4d)"


import sys
import Rhino.Geometry as rg
import Grasshopper as gh
import copy


## add alpaca install directory to system path

ghcompfolder = gh.Folders.DefaultAssemblyFolder
if ghcompfolder not in sys.path:
    sys.path.append(ghcompfolder)

try:
    from Alpaca4d import alpaca4d as alpaca
except:
    msg = "Cannot import Alpaca4d. Is the Alpaca4d folder available in " + ghcompfolder + "?"
    ghenv.Component.AddRuntimeMessage(gh.Kernel.GH_RuntimeMessageLevel.Error, msg)


checkData = True

if not E:
    checkData = False
    msg = "Input parameter E failed to collect data"
    ghenv.Component.AddRuntimeMessage(gh.Kernel.GH_RuntimeMessageLevel.Warning, msg)

if not G and not v:
    checkData = False
    msg = "Input parameter G or v failed to collect data"
    ghenv.Component.AddRuntimeMessage(gh.Kernel.GH_RuntimeMessageLevel.Warning, msg)

if not rho:
    checkData = False
    msg = "Input parameter rho failed to collect data"
    ghenv.Component.AddRuntimeMessage(gh.Kernel.GH_RuntimeMessageLevel.Warning, msg)

if checkData:
    nDMaterial = alpaca.ElasticIsotropic(name, E, G, rho, v)
# ---------- end eim ----------
pfs = PlateFiberAlpaca4d(thickness="0.15", nDMaterial=eim.nDMaterial)  # -> out, Section
# ---------- pfs: Python ----------
"""
Create a Plate Fiber Section
-
    Args:
        secName:
        thickness:
        nDMaterial:
    Returns:
        Section:
"""


import sys
import Rhino.Geometry as rg
import Grasshopper as gh
import copy

ghenv.Component.Name = "Plate Fiber (Alpaca4d)"
ghenv.Component.NickName = 'PFS'
ghenv.Component.Message = "Plate Fiber (Alpaca4d)"


## add alpaca install directory to system path

ghcompfolder = gh.Folders.DefaultAssemblyFolder
if ghcompfolder not in sys.path:
    sys.path.append(ghcompfolder)

try:
    from Alpaca4d import alpaca4d as alpaca
except:
    msg = "Cannot import Alpaca4d. Is the Alpaca4d folder available in " + ghcompfolder + "?"
    ghenv.Component.AddRuntimeMessage(gh.Kernel.GH_RuntimeMessageLevel.Error, msg)


checkData = True

if not thickness:
    checkData = False
    msg = "Input parameter thickness failed to collect data"
    ghenv.Component.AddRuntimeMessage(gh.Kernel.GH_RuntimeMessageLevel.Warning, msg)

if not nDMaterial:
    checkData = False
    msg = "Input parameter nDMaterial failed to collect data"
    ghenv.Component.AddRuntimeMessage(gh.Kernel.GH_RuntimeMessageLevel.Warning, msg)

if checkData:
    Section = alpaca.PlateFiberSection(secName, thickness, nDMaterial)
# ---------- end pfs ----------
lts = LinearTimeSeriesAlpaca4d()  # -> TimeSeries, Graph
# ---------- lts: Python ----------
"""
Create a Linear Time Series
-
    Args:
        tStart:
        tEnd:
        period:
        factor:
        shift:
    Returns:
        TimeSeries:
        Graph:
"""

ghenv.Component.Name = "Linear Time Series (Alpaca4d)"
ghenv.Component.NickName = 'LTS'
ghenv.Component.Message = "Linear Time Series (Alpaca4d)"

import sys
import Rhino.Geometry as rg
import Grasshopper as gh
import copy
import math


## add alpaca install directory to system path

ghcompfolder = gh.Folders.DefaultAssemblyFolder
if ghcompfolder not in sys.path:
    sys.path.append(ghcompfolder)

try:
    from Alpaca4d import alpaca4d as alpaca
except:
    msg = "Cannot import Alpaca4d. Is the Alpaca4d folder available in " + ghcompfolder + "?"
    ghenv.Component.AddRuntimeMessage(gh.Kernel.GH_RuntimeMessageLevel.Error, msg)


def linearSeries(x):
    return x



checkData = True

if not linearFactor:
    linearFactor = 1




if checkData:
    TimeSeries = alpaca.TimeSeriesLinear(linearFactor)
    
    Graph = []
    
    for x in range(10):
        Graph.append(linearSeries(x * linearFactor))
# ---------- end lts ----------
toggle = BooleanToggle(True)
mitc4 = ShellMITC4Alpaca4d(Mesh=clean, Section=pfs.Section)  # -> out, Element; inputs Mesh: Mesh, Colour: Color
# ---------- mitc4: Python ----------
"""
Create a ShellMITC4 element
-
    Args:
        Mesh:
        Section:
        Colour:
    Returns:
        Element:
"""

ghenv.Component.Name = "Shell MITC4 (Alpaca4d)"
ghenv.Component.NickName = 'MITC4'
ghenv.Component.Message = "ShellMITC4 (Alpaca4d)"



import sys
import Rhino.Geometry as rg
import Grasshopper as gh
import copy
from System.Drawing import Color


## add alpaca install directory to system path

ghcompfolder = gh.Folders.DefaultAssemblyFolder
if ghcompfolder not in sys.path:
    sys.path.append(ghcompfolder)

try:
    from Alpaca4d import alpaca4d as alpaca
except:
    msg = "Cannot import Alpaca4d. Is the Alpaca4d folder available in " + ghcompfolder + "?"
    ghenv.Component.AddRuntimeMessage(gh.Kernel.GH_RuntimeMessageLevel.Error, msg)


checkData = True

if not Mesh:
    checkData = False
    msg = "Input parameter Mesh failed to collect data"
    ghenv.Component.AddRuntimeMessage(gh.Kernel.GH_RuntimeMessageLevel.Warning, msg)

if not Section:
    checkData = False
    msg = "Input parameter Section failed to collect data"
    ghenv.Component.AddRuntimeMessage(gh.Kernel.GH_RuntimeMessageLevel.Warning, msg)

if not Colour:
    Colour = Color.Blue


if checkData:
    
    Mesh.Unweld(0,True)
    explodedMesh = Mesh.ExplodeAtUnweldedEdges()
    if explodedMesh.Length > 0:
        Element = []
        for mesh in explodedMesh:
            if mesh.Vertices.Count == 4:
                Element.append(alpaca.ShellMITC4(mesh, copy.deepcopy(Section), Colour))
            elif mesh.Vertices.Count == 3:
                Element.append(alpaca.ShellNLDKGT(mesh, copy.deepcopy(Section), Colour))
    elif explodedMesh.Length == 0:
        if Mesh.Vertices.Count == 4:
                Element = alpaca.ShellMITC4(Mesh, copy.deepcopy(Section), Colour)
        elif Mesh.Vertices.Count == 3:
            Element = alpaca.ShellNLDKGT(Mesh, copy.deepcopy(Section), Colour)
# ---------- end mitc4 ----------
gl = GravityLoadAlpaca4d(GravityFactor=1, TimeSeries=lts.TimeSeries)  # -> out, Load
# ---------- gl: Python ----------
"""
Create Gravity Load
-
    Args:
        Pos:
        Force:
        Moment:
        TimeSeries:
    Returns:
        PointLoad:
"""

ghenv.Component.Name = "Gravity Load (Alpaca4d)"
ghenv.Component.NickName = 'GL'
ghenv.Component.Message = "Gravity Load (Alpaca4d)"



import sys
import Rhino.Geometry as rg
import Grasshopper as gh
import copy


## add alpaca install directory to system path

ghcompfolder = gh.Folders.DefaultAssemblyFolder
if ghcompfolder not in sys.path:
    sys.path.append(ghcompfolder)

try:
    from Alpaca4d import alpaca4d as alpaca
except:
    msg = "Cannot import Alpaca4d. Is the Alpaca4d folder available in " + ghcompfolder + "?"
    ghenv.Component.AddRuntimeMessage(gh.Kernel.GH_RuntimeMessageLevel.Error, msg)

if not TimeSeries:
    TimeSeries = alpaca.TimeSeriesConstant(1)

Load = alpaca.GravityLoad(GravityFactor, TimeSeries)
# ---------- end gl ----------
support = SupportAlpaca4d(Pos=rdpoints.OutPoint, Tx=toggle, Ty=toggle, Tz=toggle, Rx=False, Ry=False, Rz=False)  # -> Support; inputs Pos: Point3d, Tx: Boolean, Ty: Boolean, Tz: Boolean, Rx: Boolean, Ry: Boolean, Rz: Boolean
# ---------- support: Python ----------
"""
Create a support
-
    Args:
        Pos:
        Tx:
        Ty:
        Tz:
        Rx:
        Ry:
    Returns:
        Support:
"""

ghenv.Component.Name = "Support (Alpaca4d)"
ghenv.Component.NickName = 'Support'
ghenv.Component.Message = "Support (Alpaca4d)"


import sys
import Rhino.Geometry as rg
import Grasshopper as gh


## add alpaca install directory to system path

ghcompfolder = gh.Folders.DefaultAssemblyFolder
if ghcompfolder not in sys.path:
    sys.path.append(ghcompfolder)

try:
    from Alpaca4d import alpaca4d as alpaca
except:
    msg = "Cannot import Alpaca4d. Is the Alpaca4d folder available in " + ghcompfolder + "?"
    ghenv.Component.AddRuntimeMessage(gh.Kernel.GH_RuntimeMessageLevel.Error, msg)

checkData = True


if not Pos:
    checkData = False
    msg = "Input parameter Pos failed to collect data"
    ghenv.Component.AddRuntimeMessage(gh.Kernel.GH_RuntimeMessageLevel.Warning, msg)

if checkData:
    Support = alpaca.Support(Pos, Tx, Ty, Tz, Rx, Ry, Rz)
# ---------- end support ----------
am = AssembleModelAlpaca4d(Element=mitc4.Element, Support=support, Load=gl.Load)  # -> out, AlpacaModel, Mass; inputs Element: list, Support: list, Load: list, Constraint: list
# ---------- am: Python ----------
"""
Create a FEA Model
-
    Args:
        Element:
        Support:
        Load:
        Constraint:
    Returns:
        AlpacaModel:
"""

ghenv.Component.Name = "Assemble Model (Alpaca4d)"
ghenv.Component.NickName = 'AM'
ghenv.Component.Message = "Assemble Model (Alpaca4d)"




import os
from Alpaca4d import alpaca4d as alpaca
import ghpythonlib.treehelpers as th
import Rhino.Geometry as rg
import Rhino.Collections as rc
import rhinoscriptsyntax as rs
from collections import defaultdict, OrderedDict
import copy
import time



FolderPath = rs.DocumentPath()
os.chdir(FolderPath)

# create the object model
AlpacaModel = alpaca.Model()


start = time.clock()
#subdivide element per type

for element in Element:
    if element.type == "Beam":
        AlpacaModel.beams.append(element)
    elif element.type == "Shell":
        AlpacaModel.shells.append(element)
    elif element.type == "Brick":
        AlpacaModel.bricks.append(element)

end = time.clock() - start

print("time to subdivide element {}".format(end))

# create a list of unique point
# need to add the rigid constraint

AlpacaModel.getuniquePoints(AlpacaModel.beams, AlpacaModel.shells, AlpacaModel.bricks, AlpacaModel.constraints)


end = time.clock() - end

print("time to get uniquepoints {}".format(end))

#############
# create node and assign to object
#############

if AlpacaModel.uniquePointsThreeNDF:
    AlpacaModel.py.append(alpaca.Model.write3ndf_tcl())
    for point in AlpacaModel.uniquePointsThreeNDF:
        node = alpaca.Node(point)
        node.ndf = 3
        node.setNodeTag(AlpacaModel.cloudPoint)
        AlpacaModel.nodes.append( node )
    
        AlpacaModel.py.append(node.write_tcl())

if AlpacaModel.uniquePointsSixNDF:
    AlpacaModel.py.append(alpaca.Model.write6ndf_tcl())
    for point in AlpacaModel.uniquePointsSixNDF:
        node = alpaca.Node(point)
        node.ndf = 6
        node.setNodeTag(AlpacaModel.cloudPoint)
        AlpacaModel.nodes.append( node )
     
        AlpacaModel.py.append(node.write_tcl())


#################
# create supports
#################

# issue if there are no 3ndf points in the DistanceTo function

for supportNode in Support:
    
    # if the list is empty, skip this operation
    if AlpacaModel.uniquePointsThreeNDF:
        closestPointInThreeNDF = rc.Point3dList.ClosestPointInList(AlpacaModel.uniquePointsThreeNDF, supportNode.Pos)
        if supportNode.Pos.DistanceTo(closestPointInThreeNDF) < 0.001:
            print("I am in 3ndf")
            supportNode.ndf = 3
            AlpacaModel.threeNDFModel.append(supportNode)
    
    if AlpacaModel.uniquePointsSixNDF:
        closestPointInSixNDF = rc.Point3dList.ClosestPointInList(AlpacaModel.uniquePointsSixNDF, supportNode.Pos)
        if supportNode.Pos.DistanceTo(closestPointInSixNDF) < 0.001:
            supportNode.ndf = 6
            AlpacaModel.sixNDFModel.append(supportNode)
    
    #else:
    #    raise ValueError('The node at location {0} is not part of the model'.format(supportNode.Pos.ToString()))
    
    supportNode.setNodeTag(AlpacaModel.cloudPoint)
    AlpacaModel.supports.append(supportNode)
    AlpacaModel.py.append(supportNode.write_tcl())


####################
# create constraints
####################


for constraint in Constraint:
    constraint.setNodeTag(AlpacaModel.cloudPoint)
    AlpacaModel.constraints.append(constraint)


# write py file


# assign tag and node Index to element and shell
for index, element in enumerate(Element,1):
    element.setTopologyRTree(AlpacaModel.RTreeCloudPoint)
    element.eleTag = index
    element.setTags()

Mass = 0
IsGravity = False

for item in Load:
    if item.type == "Gravity Load":
        IsGravity = True
        GravityLoad = item
    if item.type == "PointLoad":
        AlpacaModel.loads.append(item)


for item in Element:
    if item.type == "beam":
        length = item.Crv.Length()
        Mass += (item.massDens * length)
        if IsGravity:
            gravityPointLoad = alpaca.PointLoad(item.Crv.PointAtStart, rg.Vector3d(0,0, -(item.massDens * length / 2)) * GravityLoad.GravityFactor, rg.Vector3d(0,0,0), GravityLoad.TimeSeries)
            AlpacaModel.loads.append(gravityPointLoad)
    if item.type == "Shell":
        meshArea = rg.AreaMassProperties.Compute(item.Mesh).Area
        areaDensity = item.CrossSection.height * item.CrossSection.material.rho
        Mass += areaDensity * meshArea
        if IsGravity:
            for vertex in item.Mesh.Vertices.ToPoint3dArray():
                gravityPointLoad = alpaca.PointLoad(vertex, rg.Vector3d(0,0, -(areaDensity * meshArea/ len(item.Mesh.Vertices))) * GravityLoad.GravityFactor, rg.Vector3d(0,0,0), GravityLoad.TimeSeries)
                AlpacaModel.loads.append(gravityPointLoad)
    if item.type == "Brick":
        meshVolume = rg.VolumeMassProperties.Compute(item.Mesh).Volume
        density = item.material.rho 
        Mass += density * meshVolume
        if IsGravity:
            for vertex in item.Mesh.Vertices.ToPoint3dArray():
                gravityPointLoad = alpaca.PointLoad(vertex, rg.Vector3d(0,0, -(density * meshVolume / len(item.Mesh.Vertices))) * GravityLoad.GravityFactor, rg.Vector3d(0,0,0), GravityLoad.TimeSeries)
                AlpacaModel.loads.append(gravityPointLoad)

#print(AlpacaModel.loads)
## load

for item in AlpacaModel.loads:
    item.setNodeTag(AlpacaModel.cloudPoint)

for item in AlpacaModel.beams:
    AlpacaModel.py.append(item.write_tcl())

for item in AlpacaModel.shells:
    AlpacaModel.py.append(item.write_tcl())

for item in AlpacaModel.bricks:
    AlpacaModel.py.append(item.write_tcl())


for item in Constraint:
    AlpacaModel.py.append(item.write_tcl())


timeSeriesDict = alpaca.TimeSeries.getTimeSeries(AlpacaModel.loads)[1]
AlpacaModel.py.append(alpaca.PointLoad.write_tcl(timeSeriesDict,AlpacaModel))
# ---------- end am ----------
as = AnalysisSettingsAlpaca4d(AnalysisSteps="10")  # -> out, Analysis
# ---------- as: Python ----------
"""
Create Analysis settings
-
    Args:
        Constraint: 'Plain', 'Transformation'. Default is 'Transformation'.
        Numberer: 'RCM', 'AMD', 'Plain'. Default is 'RCM'.
        System: 'BandGen', 'BandSPD', 'ProfileSPD', 'SuperLU', 'UmfPack', 'FullGeneral', 'SparseSYM'. Default is 'BandSPD'.
        Test: Feature not implemented. Please contact alpaca4d@gmail.com 
        Algorithm: 'Linear', 'Newton', 'NewtonLineSearch', 'ModifiedNewton', 'KrylovNewton', 'SecantNewton', 'BFGS', 'Broyden'. Default is 'Linear'.
        Integrator: Default is LoadControl.
        AnalysisType: 'Static', 'Transient'. Default is 'Static'.
        AnalyesSteps:
    Returns:
        Analysis:
"""

import sys
import os


import clr
import clrtype
import Rhino.Geometry as rg
import rhinoscriptsyntax as rs
import Grasshopper as gh
import copy
import ghpythonlib.treehelpers as th


ghenv.Component.Name = "Analysis settings (Alpaca4d)"
ghenv.Component.NickName = 'AS'
ghenv.Component.Message = "Settings (Alpaca4d)"



from Alpaca4d import alpaca4d as alpaca

checkData = True


# default Value
Constraint = 'Transformation' if Constraint is None else Constraint
ConstraintList = ['Plain', 'Transformation']

for item in ConstraintList:
    if Constraint.lower() == item.lower():
        print(item)
        Constraint = item


# default Value
Numberer = 'RCM' if Numberer is None else Numberer
NumbererList = ['RCM', 'AMD', 'Plain', 'ParallelPlain', 'ParallelRCM']

for i,item in enumerate(NumbererList):
    if Numberer.lower() == item.lower():
        Numberer = item



# default Value
System = 'BandSPD' if System is None else System
SystemList = ['BandGen', 'BandSPD', 'ProfileSPD', 'SuperLU', 'UmfPack', 'FullGeneral', 'SparseSYM']

for i,item in enumerate(SystemList):
    if System.lower() == item.lower():
        System = item


# default Test
Test = 'NormDispIncr 1.0e-6 12 5' if Test is None else Test




# default Value
Algorithm = 'Linear' if Algorithm is None else Algorithm
AlgorithmList = ['Linear', 'Newton', 'NewtonLineSearch', 'ModifiedNewton', 'KrylovNewton', 'SecantNewton', 'BFGS', 'Broyden']

for i,item in enumerate(AlgorithmList):
    if Algorithm.lower() == item.lower():
        Algorithm = item


# default Value
AnalysisType = 'Static' if AnalysisType is None else AnalysisType
AnalysisTypeList = ['Static', 'Transient']

for item in AnalysisTypeList:
    if AnalysisType.lower() == item.lower():
        AnalysisType = item


## Define Integrator
if AnalysisType == "Static":
    Integrator = "LoadControl 1.0" if Integrator is None else Integrator
elif AnalysisType == "Transien":
    Integrator = "Newmark 0.5 0.25" if Integrator is None else Integrator



if not AnalysisSteps:
    checkData = False
    msg = "Input parameter AnalysisSteps failed to collect data"
    ghenv.Component.AddRuntimeMessage(gh.Kernel.GH_RuntimeMessageLevel.Warning, msg)


if checkData:
    Analysis = alpaca.Analysis(Constraint, Numberer,System,Test,Algorithm,Integrator,AnalysisType, AnalysisSteps)
# ---------- end as ----------
vm = ViewModelAlpaca4d(AlpacaModel=am.AlpacaModel, type=Toggle(False), localAxis=Toggle(True), support=Toggle(True), load=Toggle(True))  # inputs type: Boolean, nodeTag: Boolean, eleTag: Boolean, localAxis: Boolean, support: Boolean, load: Boolean
# ---------- vm: Python ----------
"""View structural Model
    Inputs:
        AlpacaModel: Output of Assemble Model.
        type: Style of visualize Model 
Default: Visualize the stick Model
True: Visualize the extrude Model
        nodeTag: 
True: Visualize tag nodes
        eleTag: 
True: Visualize tag elements 
        LocalAxes:
True: Visualize local Axis of elements 
        Support: 
True: Visualize support type
        Load: 
True: Visualize load
"""


from ghpythonlib.componentbase import executingcomponent as component
import Grasshopper, GhPython
import System
import ghpythonlib.components as ghcomp

import Rhino as rc
import rhinoscriptsyntax as rs
import sys
import Rhino.Geometry as rg
import Grasshopper as gh
import copy

ghenv.Component.Name = "View Model (Alpaca4d)"
ghenv.Component.NickName = 'VM'
ghenv.Component.Message = "View Model (Alpaca4d)"

ghcompfolder = gh.Folders.DefaultAssemblyFolder
if ghcompfolder not in sys.path:
    sys.path.append(ghcompfolder)
try:
    from Alpaca4d import alpaca4dView as alpacaView
except:
    msg = "Cannot import Alpaca4d. Is the Alpaca4d folder available in " + ghcompfolder + "?"
    ghenv.Component.AddRuntimeMessage(gh.Kernel.GH_RuntimeMessageLevel.Error, msg)

checkData = True

class MyComponent(component):
    
    def RunScript(self, AlpacaModel, type, nodeTag, eleTag, localAxis, support, load):
        
        if not AlpacaModel:
            checkData = False
            msg = "Input parameter AlpacaModel failed to collect data"
            ghenv.Component.AddRuntimeMessage(gh.Kernel.GH_RuntimeMessageLevel.Warning, msg)
        else:
            self.type = type
            
            ## add alpaca install directory to system path
            
            self.ModelBeam = alpacaView.ViewBeam( AlpacaModel, type)
            self.ModelShell = alpacaView.ViewShell( AlpacaModel, type )
            self.ModelBrick = alpacaView.ViewBrick( AlpacaModel)
            #NODE TAG VIEW
            if nodeTag is True:
                self.Nodes = [ [inode.nodeTag, inode.Pos] for inode in AlpacaModel.nodes]
            else:
                self.Nodes = []
            #ELE TAG VIEW
            if eleTag is True:
                TagBeam = [ [item.eleTag, item.getPerpFrame().Origin] for item in AlpacaModel.beams]
                TagShell = [ [item.eleTag, rg.AreaMassProperties.Compute( item.Mesh, False, True, False, False ).Centroid] for item in model.shells]
                TagBrick = [ [item.eleTag, rg.AreaMassProperties.Compute( item.Mesh, False, True, False, False ).Centroid] for item in model.bricks]
                self.TagEle = TagBeam + TagShell + TagBrick
            else:
                self.TagEle = []
            #LOCAL AXIS
            if localAxis is True:
                self.localAxis = [ item.getPerpFrame() for item in AlpacaModel.beams]
            else:
                self.localAxis = []
            #SUPPORT
            if support is True:
                scale = 0.5
                self.solidSupport = [ alpacaView.Support( iSupport, scale ) for iSupport in AlpacaModel.supports ]
            else:
                self.solidSupport = []
            # LOAD
            if load is True:
                self.viewLoad =[[item.Pos, item.Force, item.Moment] for item in AlpacaModel.loads]
            else:
                self.viewLoad = []
            self.forceBounds = ghcomp.Bounds([ item[1] for item in self.viewLoad])
            self.momentBounds = ghcomp.Bounds([ item[2] for item in self.viewLoad])

    def DrawViewportWires(self,arg):
        # Beam
        for iBeam in self.ModelBeam:
            color = iBeam[1]
            colorMaterial = rc.Display.DisplayMaterial(color, 0.3)
            if self.type is True:
                colorWirframe = System.Drawing.Color.Gray
                #System.Drawing.Color.LightGray
                arg.Display.DrawBrepShaded(iBeam[0], colorMaterial)
                arg.Display.DrawBrepWires(iBeam[0], colorWirframe)
            else :
                thickness =2
                arg.Display.DrawCurve(iBeam[0], color, thickness)
        # Mesh
        for iShell in self.ModelShell:
            color = iShell[1]
            #color = System.Drawing.Color.Blue
            colorMaterial = rc.Display.DisplayMaterial(color,color,color,color,1,0.30)
            colorMaterial.IsTwoSided = False
            arg.Display.DrawMeshShaded(iShell[0], colorMaterial)
            colorWirframe = System.Drawing.Color.Black
            arg.Display.DrawMeshWires(iShell[0], colorWirframe)
        #Brick 
        for iBrick in self.ModelBrick:
            color = iBrick[1]
            #color = System.Drawing.Color.Blue
            colorMaterial = rc.Display.DisplayMaterial(color,color,color,color,1,0.30)
            colorMaterial.IsTwoSided = False
            arg.Display.DrawMeshShaded(iBrick[0], colorMaterial)
            colorWirframe = System.Drawing.Color.Black
            arg.Display.DrawMeshWires(iBrick[0], colorWirframe)
            
        # node Tag view
        for inode in self.Nodes:
            arg.Display.Draw2dText( str(inode[0]), System.Drawing.Color.DarkSlateBlue, inode[1], True, 50)
        # ele Tag view
        for iEle in self.TagEle:
            arg.Display.Draw2dText( str(iEle[0]), System.Drawing.Color.BlanchedAlmond, iEle[1], True, 50)
        # local Axis
        for iLocalAxis in self.localAxis:
            arg.Display.DrawArrow( rg.Line(iLocalAxis.Origin, iLocalAxis.XAxis), System.Drawing.Color.Red)
            arg.Display.DrawArrow( rg.Line(iLocalAxis.Origin, iLocalAxis.YAxis), System.Drawing.Color.Green)
            arg.Display.DrawArrow( rg.Line(iLocalAxis.Origin, iLocalAxis.ZAxis), System.Drawing.Color.Blue)
            
        color = System.Drawing.Color.Azure
        colorWirframe = System.Drawing.Color.Black
        colorMaterial = rc.Display.DisplayMaterial(color, 0.0)
        for iSupport in self.solidSupport :
            arg.Display.DrawBrepShaded( iSupport, colorMaterial)
            arg.Display.DrawBrepWires( iSupport, colorWirframe)
            
        for iLoad in self.viewLoad:
            arg.Display.DrawArrow( rg.Line(iLoad[0], iLoad[1]/self.forceBounds[1]) ,  System.Drawing.Color.DarkRed)
            arg.Display.DrawArrow( rg.Line(iLoad[0], iLoad[2]/self.momentBounds[1]) ,  System.Drawing.Color.DarkBlue)
# ---------- end vm ----------
ra = RunAnalysisAlpaca4d(AlpacaModel=am.AlpacaModel, Analysis=as.Analysis)  # -> log, AlpacaSolvedModel
# ---------- ra: Python ----------
"""
Run an OpenSees Analysis
-
    Args:
        AlpacaModel:
        Analysis:
    Returns:
        AlpacaSolvedModel:
"""



import Rhino.RhinoDoc
import Grasshopper as gh
import copy
import rhinoscriptsyntax as rs
import os
import time
import sys



ghenv.Component.Name = "Run Analysis (Alpaca4d)"
ghenv.Component.NickName = 'RA'
ghenv.Component.Message = "Run Analysis (Alpaca4d)"

ghcompfolder = gh.Folders.DefaultAssemblyFolder
if ghcompfolder not in sys.path:
    sys.path.append(ghcompfolder)

try:
    from Alpaca4d import alpaca4d as alpaca
except:
    msg = "Cannot import Alpaca4d. Is the Alpaca4d folder available in " + ghcompfolder + "?"
    ghenv.Component.AddRuntimeMessage(gh.Kernel.GH_RuntimeMessageLevel.Error, msg)


checkData = True



if not AlpacaModel:
    checkData = False
    msg = "Input parameter AlpacaModel failed to collect data"
    ghenv.Component.AddRuntimeMessage(gh.Kernel.GH_RuntimeMessageLevel.Warning, msg)


if not Analysis:
    checkData = False
    msg = "Input parameter Analysis failed to collect data"
    ghenv.Component.AddRuntimeMessage(gh.Kernel.GH_RuntimeMessageLevel.Warning, msg)


if checkData:
    FolderPath = rs.DocumentPath()
    os.chdir(FolderPath)
    
    outputFileName = 'openSeesModel'
    
    for dirpath, dirnames, filenames in os.walk(FolderPath):
        for filename in filenames:
            if filename == outputFileName:
                file = os.path.join(dirpath,outputFileName)
                os.remove(file)
    
    
    # create a copy
    
    AnalysisModel = copy.copy(AlpacaModel)
    AnalysisModel.py = list(AnalysisModel.py)
    
    # generate Recorder and assign name
    AnalysisModel.recorderName = "recorder" + ".mpco"
    
    AnalysisModel.py.append(alpaca.TCLRecorder.mpco(AnalysisModel.recorderName, True,True,True,True,False,False,True,True,True,True))
    
    
    AnalysisModel.analysis = Analysis
    AnalysisModel.py.append(Analysis.write_tcl())
    AnalysisModel.py.append("wipe")
    
    
    #textFile = AnalysisModel.py
    
    time_start = time.clock()
    
    AnalysisModel.writeFile(outputFileName)
    
    time_elapsed = (time.clock() - time_start)
    print("Writing Time {}".format(time_elapsed))
    
    
    
    time_start = time.clock()
    
    executable = os.path.join(ghcompfolder,'Alpaca4d\OpenSees-Solvers\opensees.bat')
    a, log = AnalysisModel.runOpensees(executable)
    
    
    time_elapsed = (time.clock() - time_start)
    print("Analyses Time {}".format(time_elapsed))
    
    AlpacaSolvedModel = copy.copy(AnalysisModel)
    AlpacaSolvedModel.isAnalysed = True
# ---------- end ra ----------
python = GhPythonScript(AlpacaModel=ra.AlpacaSolvedModel)  # -> out, shellSortedByeleTag, shellElementsFlat
# ---------- python: Python ----------
import sys
import Rhino.Geometry as rg
import Grasshopper as gh


## add alpaca install directory to system path

ghcompfolder = gh.Folders.DefaultAssemblyFolder
if ghcompfolder not in sys.path:
    sys.path.append(ghcompfolder)

try:
    from Alpaca4d import alpaca4d as alpaca
except:
    msg = "Cannot import Alpaca4d. Is the Alpaca4d folder available in " + ghcompfolder + "?"
    ghenv.Component.AddRuntimeMessage(gh.Kernel.GH_RuntimeMessageLevel.Error, msg)



shellSortedByeleTag = sorted(AlpacaModel.shells, key=lambda x: x.eleTag)

ShellDKGT = []
ShellMITC4 = []
ASDShellQ4 = []

for item in shellSortedByeleTag:
    if item.elementType == "ShellDKGT":
        ShellDKGT.append(item)
    elif item.elementType == "ShellMITC4":
        ShellMITC4.append(item)
    elif item.elementType == "ASDShellQ4":
        ASDShellQ4.append(item)


shellElements = [ShellDKGT, ShellMITC4, ASDShellQ4]

shellElementsFlat = []
for sublist in shellElements:
    for item in sublist:
        shellElementsFlat.append(item.eleTag)

print(shellElementsFlat)
# ---------- end python ----------
panel = Panel(python.shellElementsFlat)
toggle_2 = BooleanToggle(True)  # disabled
panel_2 = Panel(python.shellSortedByeleTag)
ss = ShellStressesAlpaca4d(AlpacaModel=ra.AlpacaSolvedModel)  # -> out, p11, p22, p12, m11, m22, m12, q1, q2; inputs History: Boolean, step: Int32
# ---------- ss: Python ----------
"""
Read Shell Stresses
-
    Args:
        AlpacaModel:
        step:
    Returns:
        p11:
        p22:
        p12:
        m11:
        m22:
        m12:
        q1:
        q2:
"""

ghenv.Component.Name = "Shell Stresses (Alpaca4d)"
ghenv.Component.NickName = 'SS'
ghenv.Component.Message = "Shell Stresses (Alpaca4d) \n\n\n WIP"

import sys
import os
import System
from System.Drawing import Color


import clr
import clrtype
import Rhino.Geometry as rg
import rhinoscriptsyntax as rs
import Grasshopper as gh
import copy
import ghpythonlib.treehelpers as th


## add alpaca install directory to system path

ghcompfolder = gh.Folders.DefaultAssemblyFolder
if ghcompfolder not in sys.path:
    sys.path.append(ghcompfolder)

try:
    from Alpaca4d import alpaca4d as alpaca
except:
    msg = "Cannot import Alpaca4d. Is the Alpaca4d folder available in " + ghcompfolder + "?"
    ghenv.Component.AddRuntimeMessage(gh.Kernel.GH_RuntimeMessageLevel.Error, msg)



FolderPath = rs.DocumentPath()
os.chdir(FolderPath)


# import costum modules to read the hdf5 file

my_module_name = "Alpaca_StepReader"
my_module = sys.modules.setdefault(my_module_name, type(sys)(my_module_name))

hdfFilePath = os.path.join(ghcompfolder, "Alpaca4d\HDF5CSharp.dll")
clr.AddReferenceToFileAndPath(hdfFilePath)

from HDF5CSharp import Hdf5

try:
    Steps = my_module.Steps
except AttributeError:
    type_2d = type(System.Array.CreateInstance(float, 1, 1))

    class Steps(object):
        __metaclass__ = clrtype.ClrClass
        _clrfields = {"STEP_{}".format(i): type_2d for i in range(1000)} # it will work for model with less than 1000 steps

    my_module.Steps = Steps


checkData = True

if not AlpacaModel:
    checkData = False
    msg = "Input parameter AlpacaModel failed to collect data"
    ghenv.Component.AddRuntimeMessage(gh.Kernel.GH_RuntimeMessageLevel.Warning, msg)

History = False if History is None else History



if checkData:
    
    step = (int(AlpacaModel.analysis.NumberOfSteps) - 1) if step is None else step
# read result
    
    p11 = []
    p22 = []
    p12 = []
    
    m11 = []
    m22 = []
    m12 = []
    
    q1 = []
    q2 = []
    
    
    
    ## to fix the issue about index of different type of object
    
    if History == False:
        try:
            fileId = Hdf5.OpenFile(AlpacaModel.recorderName, True)
            
            
            
            shellSortedByeleTag = sorted(AlpacaModel.shells, key=lambda x: x.eleTag)
            
            ShellDKGT = []
            ShellMITC4 = []
            ASDShellQ4 = []
            
            
            for item in shellSortedByeleTag:
                if item.elementType == "ShellDKGT":
                    ShellDKGT.append(item)
                elif item.elementType == "ShellMITC4":
                    ShellMITC4.append(item)
                elif item.elementType == "ASDShellQ4":
                    ASDShellQ4.append(item)
            
            shellElements = [ShellDKGT, ShellMITC4, ASDShellQ4]
            
            #shellMITC4
            stressResultMITC4 = Hdf5.ReadObject[Steps](fileId, "/MODEL_STAGE[1]/RESULTS/ON_ELEMENTS/stresses/53-UnknownMovableObject[201:0:0]/DATA")
            print(stressResultMITC4)
            #ShellNLDKGT
            stressResultNLDKGT = Hdf5.ReadObject[Steps](fileId, "/MODEL_STAGE[1]/RESULTS/ON_ELEMENTS/stresses/167-UnknownMovableObject[103:0:0]/DATA")
            print(stressResultNLDKGT)
            #asdea shell
            stressResultASDShellQ4 = Hdf5.ReadObject[Steps](fileId, "/MODEL_STAGE[1]/RESULTS/ON_ELEMENTS/stresses/203-UnknownMovableObject[201:0:0]/DATA")
            
            for j,stressResult in enumerate([stressResultNLDKGT, stressResultMITC4, stressResultASDShellQ4]):
                for i in range(len(shellElements[j])):
                    p11_0 = getattr(stressResult, 'STEP_{}'.format(step))[i,0]
                    p11_1 = getattr(stressResult, 'STEP_{}'.format(step))[i,8]
                    p11_2 = getattr(stressResult, 'STEP_{}'.format(step))[i,16]
                    p11_3 = getattr(stressResult, 'STEP_{}'.format(step))[i,24]
                    
                    p11.append([p11_0,p11_1,p11_2,p11_3])
                    
                    
                    
                    p22_0 = getattr(stressResult, 'STEP_{}'.format(step))[i,1]
                    p22_1 = getattr(stressResult, 'STEP_{}'.format(step))[i,9]
                    p22_2 = getattr(stressResult, 'STEP_{}'.format(step))[i,17]
                    p22_3 = getattr(stressResult, 'STEP_{}'.format(step))[i,25]
                    
                    p22.append([p22_0,p22_1,p22_2,p22_3])
                    
                    
                    p12_0 = getattr(stressResult, 'STEP_{}'.format(step))[i,2]
                    p12_1 = getattr(stressResult, 'STEP_{}'.format(step))[i,10]
                    p12_2 = getattr(stressResult, 'STEP_{}'.format(step))[i,18]
                    p12_3 = getattr(stressResult, 'STEP_{}'.format(step))[i,26]
                    
                    p12.append([p12_0,p12_1,p12_2,p12_3])
                    
                    
                    m11_0 = getattr(stressResult, 'STEP_{}'.format(step))[i,3]
                    m11_1 = getattr(stressResult, 'STEP_{}'.format(step))[i,11]
                    m11_2 = getattr(stressResult, 'STEP_{}'.format(step))[i,19]
                    m11_3 = getattr(stressResult, 'STEP_{}'.format(step))[i,27]
                    
                    m11.append([m11_0,m11_1,m11_2,m11_3])
                    
                    
                    m22_0 = getattr(stressResult, 'STEP_{}'.format(step))[i,4]
                    m22_1 = getattr(stressResult, 'STEP_{}'.format(step))[i,12]
                    m22_2 = getattr(stressResult, 'STEP_{}'.format(step))[i,20]
                    m22_3 = getattr(stressResult, 'STEP_{}'.format(step))[i,28]
                    
                    m22.append([m22_0,m22_1,m22_2,m22_3])
                    
                    
                    m12_0 = getattr(stressResult, 'STEP_{}'.format(step))[i,5]
                    m12_1 = getattr(stressResult, 'STEP_{}'.format(step))[i,13]
                    m12_2 = getattr(stressResult, 'STEP_{}'.format(step))[i,21]
                    m12_3 = getattr(stressResult, 'STEP_{}'.format(step))[i,29]
                    
                    m12.append([m12_0,m12_1,m12_2,m12_3])
                    
                    
                    q1_0 = getattr(stressResult, 'STEP_{}'.format(step))[i,6]
                    q1_1 = getattr(stressResult, 'STEP_{}'.format(step))[i,14]
                    q1_2 = getattr(stressResult, 'STEP_{}'.format(step))[i,22]
                    q1_3 = getattr(stressResult, 'STEP_{}'.format(step))[i,30]
                    
                    q1.append([q1_0,q1_1,q1_2,q1_3])
                    
                    
                    q2_0 = getattr(stressResult, 'STEP_{}'.format(step))[i,7]
                    q2_1 = getattr(stressResult, 'STEP_{}'.format(step))[i,15]
                    q2_2 = getattr(stressResult, 'STEP_{}'.format(step))[i,23]
                    q2_3 = getattr(stressResult, 'STEP_{}'.format(step))[i,31]
                    
                    q2.append([q2_0,q2_1,q2_2,q2_3])
                    
                    
                    
            Hdf5.CloseFile(fileId)
            print("I have close the file")
            
        except:
            Hdf5.CloseFile(fileId)
            print("I have close the file")
    
    
    elif History == True:
        try:
            fileId = Hdf5.OpenFile(AlpacaModel.recorderName, True)
        
            maxNumberStep = int(AlpacaModel.analysis.NumberOfSteps)
            
            stressResult = Hdf5.ReadObject[Steps](fileId, "/MODEL_STAGE[1]/RESULTS/ON_ELEMENTS/stresses/53-UnknownMovableObject[201:0:0]/DATA")
            #stressResult = Hdf5.ReadObject[Steps](fileId, "/MODEL_STAGE[1]/RESULTS/ON_ELEMENTS/stresses/167-UnknownMovableObject[103:0:0]/DATA")
            
            
            for i,item in enumerate(AlpacaModel.shells):
                
                p11Temp = []
                p22Temp = []
                p12Temp = []
                
                m11Temp = []
                m22Temp = []
                m12Temp = []
                
                q1Temp = []
                q2Temp = []
                
                
                for n_step in range(maxNumberStep):
                    p11_0 = getattr(stressResult, 'STEP_{}'.format(n_step))[i,0]
                    p11_1 = getattr(stressResult, 'STEP_{}'.format(n_step))[i,8]
                    p11_2 = getattr(stressResult, 'STEP_{}'.format(n_step))[i,16]
                    p11_3 = getattr(stressResult, 'STEP_{}'.format(n_step))[i,24]
                    
                    p11Temp.append([p11_0,p11_1,p11_2,p11_3])
                    
                    
                    
                    p22_0 = getattr(stressResult, 'STEP_{}'.format(n_step))[i,1]
                    p22_1 = getattr(stressResult, 'STEP_{}'.format(n_step))[i,9]
                    p22_2 = getattr(stressResult, 'STEP_{}'.format(n_step))[i,17]
                    p22_3 = getattr(stressResult, 'STEP_{}'.format(n_step))[i,25]
                    
                    p22Temp.append([p22_0,p22_1,p22_2,p22_3])
                    
                    
                    p12_0 = getattr(stressResult, 'STEP_{}'.format(n_step))[i,2]
                    p12_1 = getattr(stressResult, 'STEP_{}'.format(n_step))[i,10]
                    p12_2 = getattr(stressResult, 'STEP_{}'.format(n_step))[i,18]
                    p12_3 = getattr(stressResult, 'STEP_{}'.format(n_step))[i,26]
                    
                    p12Temp.append([p12_0,p12_1,p12_2,p12_3])
                    
                    
                    m11_0 = getattr(stressResult, 'STEP_{}'.format(n_step))[i,3]
                    m11_1 = getattr(stressResult, 'STEP_{}'.format(n_step))[i,11]
                    m11_2 = getattr(stressResult, 'STEP_{}'.format(n_step))[i,19]
                    m11_3 = getattr(stressResult, 'STEP_{}'.format(n_step))[i,27]
                    
                    m11Temp.append([m11_0,m11_1,m11_2,m11_3])
                    
                    
                    m22_0 = getattr(stressResult, 'STEP_{}'.format(n_step))[i,4]
                    m22_1 = getattr(stressResult, 'STEP_{}'.format(n_step))[i,12]
                    m22_2 = getattr(stressResult, 'STEP_{}'.format(n_step))[i,20]
                    m22_3 = getattr(stressResult, 'STEP_{}'.format(n_step))[i,28]
                    
                    m22Temp.append([m22_0,m22_1,m22_2,m22_3])
                    
                    
                    m12_0 = getattr(stressResult, 'STEP_{}'.format(n_step))[i,5]
                    m12_1 = getattr(stressResult, 'STEP_{}'.format(n_step))[i,13]
                    m12_2 = getattr(stressResult, 'STEP_{}'.format(n_step))[i,21]
                    m12_3 = getattr(stressResult, 'STEP_{}'.format(n_step))[i,29]
                    
                    m12Temp.append([m12_0,m12_1,m12_2,m12_3])
                    
                    
                    q1_0 = getattr(stressResult, 'STEP_{}'.format(n_step))[i,6]
                    q1_1 = getattr(stressResult, 'STEP_{}'.format(n_step))[i,14]
                    q1_2 = getattr(stressResult, 'STEP_{}'.format(n_step))[i,22]
                    q1_3 = getattr(stressResult, 'STEP_{}'.format(n_step))[i,30]
                    
                    q1Temp.append([q1_0,q1_1,q1_2,q1_3])
                    
                    
                    q2_0 = getattr(stressResult, 'STEP_{}'.format(n_step))[i,7]
                    q2_1 = getattr(stressResult, 'STEP_{}'.format(n_step))[i,15]
                    q2_2 = getattr(stressResult, 'STEP_{}'.format(n_step))[i,23]
                    q2_3 = getattr(stressResult, 'STEP_{}'.format(n_step))[i,31]
                    
                    q2Temp.append([q2_0,q2_1,q2_2,q2_3])
                
                p11.append(p11Temp)
                p22.append(p22Temp)
                p12.append(p12Temp)
                
                m11.append(m11Temp)
                m22.append(m22Temp)
                m12.append(m12Temp)
                
                q1.append(q1Temp)
                q2.append(q2Temp)
            Hdf5.CloseFile(fileId)
            print("I have close the file")
        except:
            Hdf5.CloseFile(fileId)
            print("I have close the file")
    
    
    shellElementsFlat = []
    for sublist in shellElements:
        for item in sublist:
            shellElementsFlat.append(item.eleTag)
    
    print(shellElementsFlat)
    
    
    
    
    p11 = [x for _,x in sorted(zip(shellElementsFlat, p11))]
    p22 = [x for _,x in sorted(zip(shellElementsFlat, p22))]
    p12 = [x for _,x in sorted(zip(shellElementsFlat, p12))]
    
    
    m11 = [x for _,x in sorted(zip(shellElementsFlat, m11))]
    m22 = [x for _,x in sorted(zip(shellElementsFlat, m22))]
    m12 = [x for _,x in sorted(zip(shellElementsFlat, m12))]
    
    
    q1 = [x for _,x in sorted(zip(shellElementsFlat, q1))]
    q2 = [x for _,x in sorted(zip(shellElementsFlat, q2))]
    """
    
    X = ["a", "b", "c", "d", "e", "f", "g", "h", "i"]
    Y = [ 0,   1,   1,    0,   1,   2,   2,   0,   1]
    
    Z = [x for _,x in sorted(zip(Y,X))]
    print(Z)  # ["a", "d", "h", "b", "c", "e", "i", "f", "g"]
    """
    
    p11 = th.list_to_tree(p11)
    p22 = th.list_to_tree(p22)
    p12 = th.list_to_tree(p12)
    
    m11 = th.list_to_tree(m11)
    m22 = th.list_to_tree(m22)
    m12 = th.list_to_tree(m12)
    
    q1 = th.list_to_tree(q1)
    q2 = th.list_to_tree(q2)
# ---------- end ss ----------
ss_2 = ShellStressesAlpaca4d(AlpacaModel=ra.AlpacaSolvedModel, History=toggle_2)  # -> out, p11, p22, p12, m11, m22, m12, q1, q2; inputs History: Boolean, step: Int32; disabled
# ---------- ss_2: Python ----------
"""
Read Shell Stresses
-
    Args:
        AlpacaModel:
        step:
    Returns:
        p11:
        p22:
        p12:
        m11:
        m22:
        m12:
        q1:
        q2:
"""

ghenv.Component.Name = "Shell Stresses (Alpaca4d)"
ghenv.Component.NickName = 'SS'
ghenv.Component.Message = "Shell Stresses (Alpaca4d)"

import sys
import os
import System
from System.Drawing import Color


import clr
import clrtype
import Rhino.Geometry as rg
import rhinoscriptsyntax as rs
import Grasshopper as gh
import copy
import ghpythonlib.treehelpers as th


## add alpaca install directory to system path

ghcompfolder = gh.Folders.DefaultAssemblyFolder
if ghcompfolder not in sys.path:
    sys.path.append(ghcompfolder)

try:
    from Alpaca4d import alpaca4d as alpaca
except:
    msg = "Cannot import Alpaca4d. Is the Alpaca4d folder available in " + ghcompfolder + "?"
    ghenv.Component.AddRuntimeMessage(gh.Kernel.GH_RuntimeMessageLevel.Error, msg)



FolderPath = rs.DocumentPath()
os.chdir(FolderPath)


# import costum modules to read the hdf5 file

my_module_name = "Alpaca_StepReader"
my_module = sys.modules.setdefault(my_module_name, type(sys)(my_module_name))

hdfFilePath = os.path.join(ghcompfolder, "Alpaca4d\HDF5CSharp.dll")
clr.AddReferenceToFileAndPath(hdfFilePath)

from HDF5CSharp import Hdf5

try:
    Steps = my_module.Steps
except AttributeError:
    type_2d = type(System.Array.CreateInstance(float, 1, 1))

    class Steps(object):
        __metaclass__ = clrtype.ClrClass
        _clrfields = {"STEP_{}".format(i): type_2d for i in range(1000)} # it will work for model with less than 1000 steps

    my_module.Steps = Steps


checkData = True

if not AlpacaModel:
    checkData = False
    msg = "Input parameter AlpacaModel failed to collect data"
    ghenv.Component.AddRuntimeMessage(gh.Kernel.GH_RuntimeMessageLevel.Warning, msg)

History = False if History is None else History

if checkData:
    
    step = (int(AlpacaModel.analysis.NumberOfSteps) - 1) if step is None else step
# read result
    
    p11 = []
    p22 = []
    p12 = []
    
    m11 = []
    m22 = []
    m12 = []
    
    q1 = []
    q2 = []
    
    
    
    ## to fix the issue about index of different type of object
    
    if History == False:
        try:
            fileId = Hdf5.OpenFile(AlpacaModel.recorderName, True)
            
            #asdea shell
            #stressResult = Hdf5.ReadObject[Steps](fileId, "/MODEL_STAGE[1]/RESULTS/ON_ELEMENTS/stresses/203-UnknownMovableObject[201:0:0]/DATA")
            
            #shellMITC4
            stressResult = Hdf5.ReadObject[Steps](fileId, "/MODEL_STAGE[1]/RESULTS/ON_ELEMENTS/stresses/53-UnknownMovableObject[201:0:0]/DATA")
            
            #ShellNLDKGT
            #stressResult = Hdf5.ReadObject[Steps](fileId, "/MODEL_STAGE[1]/RESULTS/ON_ELEMENTS/stresses/167-UnknownMovableObject[103:0:0]/DATA")
            for i,item in enumerate(AlpacaModel.shells):
                
                p11_0 = getattr(stressResult, 'STEP_{}'.format(step))[i,0]
                p11_1 = getattr(stressResult, 'STEP_{}'.format(step))[i,8]
                p11_2 = getattr(stressResult, 'STEP_{}'.format(step))[i,16]
                p11_3 = getattr(stressResult, 'STEP_{}'.format(step))[i,24]
                
                
                p11.append([p11_0,p11_1,p11_2,p11_3])
                
                
                
                p22_0 = getattr(stressResult, 'STEP_{}'.format(step))[i,1]
                p22_1 = getattr(stressResult, 'STEP_{}'.format(step))[i,9]
                p22_2 = getattr(stressResult, 'STEP_{}'.format(step))[i,17]
                p22_3 = getattr(stressResult, 'STEP_{}'.format(step))[i,25]
                
                p22.append([p22_0,p22_1,p22_2,p22_3])
                
                
                p12_0 = getattr(stressResult, 'STEP_{}'.format(step))[i,2]
                p12_1 = getattr(stressResult, 'STEP_{}'.format(step))[i,10]
                p12_2 = getattr(stressResult, 'STEP_{}'.format(step))[i,18]
                p12_3 = getattr(stressResult, 'STEP_{}'.format(step))[i,26]
                
                p12.append([p12_0,p12_1,p12_2,p12_3])
                
                
                m11_0 = getattr(stressResult, 'STEP_{}'.format(step))[i,3]
                m11_1 = getattr(stressResult, 'STEP_{}'.format(step))[i,11]
                m11_2 = getattr(stressResult, 'STEP_{}'.format(step))[i,19]
                m11_3 = getattr(stressResult, 'STEP_{}'.format(step))[i,27]
                
                m11.append([m11_0,m11_1,m11_2,m11_3])
                
                
                m22_0 = getattr(stressResult, 'STEP_{}'.format(step))[i,4]
                m22_1 = getattr(stressResult, 'STEP_{}'.format(step))[i,12]
                m22_2 = getattr(stressResult, 'STEP_{}'.format(step))[i,20]
                m22_3 = getattr(stressResult, 'STEP_{}'.format(step))[i,28]
                
                m22.append([m22_0,m22_1,m22_2,m22_3])
                
                
                m12_0 = getattr(stressResult, 'STEP_{}'.format(step))[i,5]
                m12_1 = getattr(stressResult, 'STEP_{}'.format(step))[i,13]
                m12_2 = getattr(stressResult, 'STEP_{}'.format(step))[i,21]
                m12_3 = getattr(stressResult, 'STEP_{}'.format(step))[i,29]
                
                m12.append([m12_0,m12_1,m12_2,m12_3])
                
                
                q1_0 = getattr(stressResult, 'STEP_{}'.format(step))[i,6]
                q1_1 = getattr(stressResult, 'STEP_{}'.format(step))[i,14]
                q1_2 = getattr(stressResult, 'STEP_{}'.format(step))[i,22]
                q1_3 = getattr(stressResult, 'STEP_{}'.format(step))[i,30]
                
                q1.append([q1_0,q1_1,q1_2,q1_3])
                
                
                q2_0 = getattr(stressResult, 'STEP_{}'.format(step))[i,7]
                q2_1 = getattr(stressResult, 'STEP_{}'.format(step))[i,15]
                q2_2 = getattr(stressResult, 'STEP_{}'.format(step))[i,23]
                q2_3 = getattr(stressResult, 'STEP_{}'.format(step))[i,31]
                
                q2.append([q2_0,q2_1,q2_2,q2_3])
                
                
                
            Hdf5.CloseFile(fileId)
            print("I have close the file")
        except:
            Hdf5.CloseFile(fileId)
            print("I have close the file")
    
    
    elif History == True:
        try:
            fileId = Hdf5.OpenFile(AlpacaModel.recorderName, True)
        
            maxNumberStep = int(AlpacaModel.analysis.NumberOfSteps)
            
            stressResult = Hdf5.ReadObject[Steps](fileId, "/MODEL_STAGE[1]/RESULTS/ON_ELEMENTS/stresses/53-UnknownMovableObject[201:0:0]/DATA")
            #stressResult = Hdf5.ReadObject[Steps](fileId, "/MODEL_STAGE[1]/RESULTS/ON_ELEMENTS/stresses/167-UnknownMovableObject[103:0:0]/DATA")
            
            
            for i,item in enumerate(AlpacaModel.shells):
                
                p11Temp = []
                p22Temp = []
                p12Temp = []
                
                m11Temp = []
                m22Temp = []
                m12Temp = []
                
                q1Temp = []
                q2Temp = []
                
                
                for n_step in range(maxNumberStep):
                    p11_0 = getattr(stressResult, 'STEP_{}'.format(n_step))[i,0]
                    p11_1 = getattr(stressResult, 'STEP_{}'.format(n_step))[i,8]
                    p11_2 = getattr(stressResult, 'STEP_{}'.format(n_step))[i,16]
                    p11_3 = getattr(stressResult, 'STEP_{}'.format(n_step))[i,24]
                    
                    p11Temp.append([p11_0,p11_1,p11_2,p11_3])
                    
                    
                    
                    p22_0 = getattr(stressResult, 'STEP_{}'.format(n_step))[i,1]
                    p22_1 = getattr(stressResult, 'STEP_{}'.format(n_step))[i,9]
                    p22_2 = getattr(stressResult, 'STEP_{}'.format(n_step))[i,17]
                    p22_3 = getattr(stressResult, 'STEP_{}'.format(n_step))[i,25]
                    
                    p22Temp.append([p22_0,p22_1,p22_2,p22_3])
                    
                    
                    p12_0 = getattr(stressResult, 'STEP_{}'.format(n_step))[i,2]
                    p12_1 = getattr(stressResult, 'STEP_{}'.format(n_step))[i,10]
                    p12_2 = getattr(stressResult, 'STEP_{}'.format(n_step))[i,18]
                    p12_3 = getattr(stressResult, 'STEP_{}'.format(n_step))[i,26]
                    
                    p12Temp.append([p12_0,p12_1,p12_2,p12_3])
                    
                    
                    m11_0 = getattr(stressResult, 'STEP_{}'.format(n_step))[i,3]
                    m11_1 = getattr(stressResult, 'STEP_{}'.format(n_step))[i,11]
                    m11_2 = getattr(stressResult, 'STEP_{}'.format(n_step))[i,19]
                    m11_3 = getattr(stressResult, 'STEP_{}'.format(n_step))[i,27]
                    
                    m11Temp.append([m11_0,m11_1,m11_2,m11_3])
                    
                    
                    m22_0 = getattr(stressResult, 'STEP_{}'.format(n_step))[i,4]
                    m22_1 = getattr(stressResult, 'STEP_{}'.format(n_step))[i,12]
                    m22_2 = getattr(stressResult, 'STEP_{}'.format(n_step))[i,20]
                    m22_3 = getattr(stressResult, 'STEP_{}'.format(n_step))[i,28]
                    
                    m22Temp.append([m22_0,m22_1,m22_2,m22_3])
                    
                    
                    m12_0 = getattr(stressResult, 'STEP_{}'.format(n_step))[i,5]
                    m12_1 = getattr(stressResult, 'STEP_{}'.format(n_step))[i,13]
                    m12_2 = getattr(stressResult, 'STEP_{}'.format(n_step))[i,21]
                    m12_3 = getattr(stressResult, 'STEP_{}'.format(n_step))[i,29]
                    
                    m12Temp.append([m12_0,m12_1,m12_2,m12_3])
                    
                    
                    q1_0 = getattr(stressResult, 'STEP_{}'.format(n_step))[i,6]
                    q1_1 = getattr(stressResult, 'STEP_{}'.format(n_step))[i,14]
                    q1_2 = getattr(stressResult, 'STEP_{}'.format(n_step))[i,22]
                    q1_3 = getattr(stressResult, 'STEP_{}'.format(n_step))[i,30]
                    
                    q1Temp.append([q1_0,q1_1,q1_2,q1_3])
                    
                    
                    q2_0 = getattr(stressResult, 'STEP_{}'.format(n_step))[i,7]
                    q2_1 = getattr(stressResult, 'STEP_{}'.format(n_step))[i,15]
                    q2_2 = getattr(stressResult, 'STEP_{}'.format(n_step))[i,23]
                    q2_3 = getattr(stressResult, 'STEP_{}'.format(n_step))[i,31]
                    
                    q2Temp.append([q2_0,q2_1,q2_2,q2_3])
                
                p11.append(p11Temp)
                p22.append(p22Temp)
                p12.append(p12Temp)
                
                m11.append(m11Temp)
                m22.append(m22Temp)
                m12.append(m12Temp)
                
                q1.append(q1Temp)
                q2.append(q2Temp)
            Hdf5.CloseFile(fileId)
            print("I have close the file")
        except:
            Hdf5.CloseFile(fileId)
            print("I have close the file")
    
    
    
    
    p11 = th.list_to_tree(p11)
    p22 = th.list_to_tree(p22)
    p12 = th.list_to_tree(p12)
    
    m11 = th.list_to_tree(m11)
    m22 = th.list_to_tree(m22)
    m12 = th.list_to_tree(m12)
    
    q1 = th.list_to_tree(q1)
    q2 = th.list_to_tree(q2)
# ---------- end ss_2 ----------
panel_3 = Panel(ss.m11)
