# Grasshopper definition karambaToAlpaca_Dynamic.gh (Grasshopper 1.0.7)
# plug-ins: karambaGH, Human, MeshEdit Components, treesloth01, NGon, Weaverbird

series = Series(Start=0, Step="3", Count=Slider(5, range=1..10))
rectangle = Rectangle(Plane=PlaneXY(0, 0, 0), XSize="3", YSize="3", Radius=0)  # -> Rectangle, Length
Z = UnitZ(Factor=series)
move = Move(Geometry=rectangle.Rectangle, Motion=Z)  # -> Geometry, Transform
explode = Explode(Curve=move.Geometry, Recursive=True)  # -> Segments, Vertices
flip = FlipMatrix(Data=explode.Vertices)
pline = PolyLine(Vertices=explode.Vertices, Closed=False)  # -> flatten(Polyline)
pline_2 = PolyLine(Vertices=flip, Closed=False)  # -> flatten(Polyline)
cull_i = CullIndex(List=pline, Indices="0", Wrap=True)
explode_2 = Explode(Curve=pline_2, Recursive=True)  # -> flatten(Segments), Vertices
explode_3 = Explode(Curve=cull_i, Recursive=True)  # -> Segments, Vertices

# ---- group: Define Materials
matselect = MaterialSelectionKaramba3D(menu=[dropdown(1), dropdown(5)])

# ----
end = EndPoints(Curve=pline_2)  # -> Start, End
divide = DivideCurve(Curve=explode_3.Segments, Count="4", Kinks=False)  # -> Points, Tangents, Parameters
divide_2 = DivideCurve(Curve=explode_2.Segments, Count="4", Kinks=False)  # -> Points, Tangents, Parameters
shift = ShiftPaths(Data=divide.Points, Offset=-1)
pline_3 = PolyLine(Vertices=divide_2.Points, Closed=False)
explode_4 = Explode(Curve=pline_3, Recursive=True)  # -> Segments, Vertices
cullpt = CullDuplicates(Points=shift, Tolerance="0.01", CullMode=1)  # -> Points, Indices, Valence
pline_4 = PolyLine(Vertices=cullpt.Points, Closed=invert(False))
explode_5 = Explode(Curve=pline_4, Recursive=True)  # -> Segments, simplify(Vertices)
list = ValueList({"Ipe": 0, "Rectangle": 1, "circle": 2}, selected="circle")

range = Range(Domain="15 to 35", Steps=10)
range_2 = Range(Domain="5 to 35", Steps=10)
range_3 = Range(Domain="5 to 35", Steps=10)
concat = Concatenate(FragmentA="Square", FragmentB=range_2)
multiplication = Multiplication(A=range_2, B=2)
concat_2 = Concatenate(FragmentA="circle", FragmentB=range_3)
cross_section = CrossSectionKaramba3D(
    FamilyNameOfCrossSection="circle",
    NameOfCrossSection=concat_2,
    Height_cm=range,
    UpperFlangeWidth_cm=range,
    LowerFlangeWidth_cm=range,
    UpperFlangeThickness_cm="2",
    LowerFlangeThickness_cm="2",
    WebThickness_cm="2",
    FilletRadius_cm="0.00",
    mode="I")
cross_section_2 = CrossSectionKaramba3D(
    FamilyNameOfCrossSection="Square",
    NameOfCrossSection=concat,
    Material=matselect,
    Height_cm=multiplication,
    UpperFlangeWidth_cm=range_2,
    LowerFlangeWidth_cm=range_2,
    mode="Trapezoid")
cross_section_3 = CrossSectionKaramba3D(
    FamilyNameOfCrossSection="circle",
    NameOfCrossSection=concat_2,
    Material=matselect,
    Diameter_cm=range_3,
    WallThickness_cm=expr("x*0.1", range_3),
    mode="Circular Hollow")
crosec = CrossSectionKaramba3D(cross_section_3)
crosec_2 = CrossSectionKaramba3D(cross_section_2)
crosec_3 = CrossSectionKaramba3D(cross_section_2)
list_2 = ValueList({"Ipe": 0, "Rectangle": 1, "circle": 2}, selected="Rectangle")
filter = StreamFilter(Gate=list_2, Stream0=cross_section, Stream1=crosec_3, Stream2=crosec)
filter_2 = StreamFilter(Gate=list, Stream0=cross_section, Stream1=crosec_2, Stream2=crosec)

number_slider = Slider(32342, range=0..100000)
range_4 = Range(Domain="15 to 35", Steps=10)
uem = UniaxialElasticMaterialAlpaca4d(E=number_slider, v="0.3", rho=number_slider)  # -> out, uniAxialMaterial
# ---------- uem: Python ----------
"""
Create a uniaxial Elastic Material
-
    Args:
        E:
        Eneg:
        eta:
        G:
        v:
        rho:
    Returns:
        uniAxialMaterial:
"""

ghenv.Component.Name = "uniaxial Elastic Material (Alpaca4d)"
ghenv.Component.NickName = 'UEM'
ghenv.Component.Message = "uniaxial Elastic (Alpaca4d)"

import sys
import Rhino.Geometry as rg
import Grasshopper as gh
import copy


## add alpaca install directory to system path

ghcompfolder = gh.Folders.DefaultAssemblyFolder
if ghcompfolder not in sys.path:
    sys.path.append(ghcompfolder)

try:
    from Alpaca4d import alpaca4d as alpaca
except:
    msg = "Cannot import Alpaca4d. Is the Alpaca4d folder available in " + ghcompfolder + "?"
    ghenv.Component.AddRuntimeMessage(gh.Kernel.GH_RuntimeMessageLevel.Error, msg)


checkData = True

if not E:
    checkData = False
    msg = "Input parameter E failed to collect data"
    ghenv.Component.AddRuntimeMessage(gh.Kernel.GH_RuntimeMessageLevel.Warning, msg)

if not G and not v:
    checkData = False
    msg = "Input parameter G or v failed to collect data"
    ghenv.Component.AddRuntimeMessage(gh.Kernel.GH_RuntimeMessageLevel.Warning, msg)

if not rho:
    checkData = False
    msg = "Input parameter rho failed to collect data"
    ghenv.Component.AddRuntimeMessage(gh.Kernel.GH_RuntimeMessageLevel.Warning, msg)



if checkData:
    uniAxialMaterial = alpaca.uniAxialMaterialElastic(name, E, Eneg, eta, G, v, rho)
# ---------- end uem ----------
num = Number(expr("x/100", range_4))
num_2 = Number(expr("x/100", "2"))
cross_section_4 = CrossSectionKaramba3D(
    FamilyNameOfCrossSection="circle",
    NameOfCrossSection=concat_2,
    Height_cm=range_4,
    UpperFlangeWidth_cm=range_4,
    LowerFlangeWidth_cm=range_4,
    UpperFlangeThickness_cm="2",
    LowerFlangeThickness_cm="2",
    WebThickness_cm="2",
    FilletRadius_cm="0.00",
    mode="I")
dts = DoubleTSectionAlpaca4d(Bsup=num, tsup=num_2, Binf=num, tinf=num_2, H=num, tw=num_2, material=uem.uniAxialMaterial)  # -> Section
# ---------- dts: Python ----------
"""
Create a double T Cross Section
-
    Args:
        secName:
        Bsup:
        tsup:
        Binf:
        tinf:
        H:
        tw:
        material:
    Returns:
        Section:
"""
ghenv.Component.Name = "doubleT Section (Alpaca4d)"
ghenv.Component.NickName = 'DTS'
ghenv.Component.Message = "doubleT Section (Alpaca4d)"

import sys
import Rhino.Geometry as rg
import Grasshopper as gh
import copy



## add alpaca install directory to system path

ghcompfolder = gh.Folders.DefaultAssemblyFolder
if ghcompfolder not in sys.path:
    sys.path.append(ghcompfolder)

try:
    from Alpaca4d import alpaca4d as alpaca
except:
    msg = "Cannot import Alpaca4d. Is the Alpaca4d folder available in " + ghcompfolder + "?"
    ghenv.Component.AddRuntimeMessage(gh.Kernel.GH_RuntimeMessageLevel.Error, msg)


checkData = True

if not Bsup:
    checkData = False
    msg = "Input parameter Bsup failed to collect data"
    ghenv.Component.AddRuntimeMessage(gh.Kernel.GH_RuntimeMessageLevel.Warning, msg)

if not tsup:
    checkData = False
    msg = "Input parameter tsup failed to collect data"
    ghenv.Component.AddRuntimeMessage(gh.Kernel.GH_RuntimeMessageLevel.Warning, msg)

if not Binf:
    checkData = False
    msg = "Input parameter Binf failed to collect data"
    ghenv.Component.AddRuntimeMessage(gh.Kernel.GH_RuntimeMessageLevel.Warning, msg)

if not tinf:
    checkData = False
    msg = "Input parameter tinf failed to collect data"
    ghenv.Component.AddRuntimeMessage(gh.Kernel.GH_RuntimeMessageLevel.Warning, msg)

if not H:
    checkData = False
    msg = "Input parameter H failed to collect data"
    ghenv.Component.AddRuntimeMessage(gh.Kernel.GH_RuntimeMessageLevel.Warning, msg)

if not tw:
    checkData = False
    msg = "Input parameter tw failed to collect data"
    ghenv.Component.AddRuntimeMessage(gh.Kernel.GH_RuntimeMessageLevel.Warning, msg)

if not material:
    checkData = False
    msg = "Input parameter material failed to collect data"
    ghenv.Component.AddRuntimeMessage(gh.Kernel.GH_RuntimeMessageLevel.Warning, msg)



if checkData:
    dTCS = alpaca.doubleTCS(Bsup, tsup, Binf, tinf, H, tw, material)
    Section = alpaca.ElasticSection(secName, dTCS.Area(), dTCS.Izz(), dTCS.Iyy(), dTCS.J(), dTCS.alphaY(), dTCS.alphaZ(), dTCS.material)
    Section.crv = dTCS.crv
    Section.sectionBrep = dTCS.sectionBrep
# ---------- end dts ----------

del = DelaunayMesh(Points=cullpt.Points, Plane=PlaneXY(0, 0, 0))
wbnaked = WeaverbirdsNakedBoundary(MeshClosedPolylines=del)
disassemble = DisassembleCrossSectionKaramba3D(CroSec=cross_section_4)  # -> CrossSection, FamilyNameOfCrossSection, TypeNameOfCrossSection, ElemIdentifiers, Color, Material, LocalEccentricity_cm, Heights_cm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
ds = DisassembleSectionAlpaca4d(Section=dts)  # -> Area, AreaY, AreaZ, alphaY, alphaZ, Iyy, Izz, J
# ---------- ds: Python ----------
"""
Create a Force Beam Column
-
    Args:
        Line:
        Section:
        Colour:
        Z_Axis:
    Returns:
        Element:
"""

ghenv.Component.Name = "Disassemble Section (Alpaca4d)"
ghenv.Component.NickName = 'DS'
ghenv.Component.Message = "Disassemble Section (Alpaca4d)"


import sys
import Rhino.Geometry as rg
import Grasshopper as gh
import ghpythonlib.components as ghcomp
from System.Drawing import Color

## add alpaca install directory to system path

ghcompfolder = gh.Folders.DefaultAssemblyFolder
if ghcompfolder not in sys.path:
    sys.path.append(ghcompfolder)

try:
    from Alpaca4d import alpaca4d as alpaca
except:
    msg = "Cannot import Alpaca4d. Is the Alpaca4d folder available in " + ghcompfolder + "?"
    ghenv.Component.AddRuntimeMessage(gh.Kernel.GH_RuntimeMessageLevel.Error, msg)


checkData = True

if not Section:
    checkData = False
    msg = "Input parameter Section failed to collect data"
    ghenv.Component.AddRuntimeMessage(gh.Kernel.GH_RuntimeMessageLevel.Warning, msg)


if checkData:
    Area = Section.Area
    AreaY = Section.AreaY
    AreaZ = Section.AreaZ
    alphaY = Section.alphaY
    alphaZ = Section.alphaZ
    AreaZ = Section.AreaZ
    Iyy = Section.Iyy
    Izz = Section.Izz
    J = Section.J
# ---------- end ds ----------
explode_6 = Explode(Curve=wbnaked, Recursive=True)  # -> Segments, Vertices
remesh = Remesh(Mesh=del, FixEdges=True, EdgeLength=0, Iterations=10, FixPt=explode_6.Vertices, Project=True, Loops=False)
num_3 = Number(expr("x/10000", disassemble.Area_cm2))
num_4 = Number(expr("x/10000", disassemble.AreaY_cm2))
num_5 = Number(expr("x/10000", disassemble.AreaZ_cm2))
num_6 = Number(expr("x/100000000", disassemble.Ipp_cm4))
num_7 = Number(expr("x/100000000", disassemble.Iyy_cm4))
num_8 = Number(expr("x/100000000", disassemble.Izz_cm4))
swatch = ColourSwatch(SwatchColor=RGB(0, 132, 255))
panel = Panel("Wind")
entwine = Entwine(Branch00=num_3, Branch01=num_4, Branch02=num_5, Branch03=num_7, Branch04=num_8, FlattenInputs=True)
entwine_2 = Entwine(Branch00=ds.Area, Branch01=ds.AreaY, Branch02=ds.AreaZ, Branch03=ds.Iyy, Branch04=ds.Izz, FlattenInputs=True)

pt = Point(end.Start)
rdpoints = RemoveDuplicatePointsKaramba3D(Point=flatten(pt), LimitDistance=0.005)  # -> OutPoint, Info, Indexes
supp = SupportKaramba(PosInd=rdpoints.OutPoint, menu=[buttons(on, on, on, on, on, on)])

cross_section_5 = CrossSectionKaramba3D(FamilyNameOfCrossSection="DefaultCroSec", Material=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, Height_cm="2", mode="Shell - Const")
loads = LoadsKaramba3D(Vector=Vector(0, 0, -1), mode="Gravity")
flip_2 = FlipMatrix(Data=entwine)  # -> simplify(Data)
flip_3 = FlipMatrix(Data=entwine_2)  # -> simplify(Data)

# ---- group: Define Elements
vec = VectorXYZ(XComponent="1", YComponent="1", ZComponent="1")  # -> Vector, Length
item = ListItem(List=filter_2, Index=0, Wrap=True)
linetobeam = LineToBeamKaramba3D(
    Line=explode_5.Segments,
    Color=swatch,
    Identifier="beam",
    CrossSection=item,
    New=True,
    Remove=True,
    LimitDistance_m=0.005,
    ZOrientation=vec.Vector)  # -> Element, Points, Info

# ----
X = UnitX(Factor=1)

# ---- group: Define Elements
item_2 = ListItem(List=filter, Index=0, Wrap=True)
linetobeam_2 = LineToBeamKaramba3D(
    Line=explode_4.Segments,
    Color=swatch,
    Identifier="Column",
    CrossSection=item_2,
    New=True,
    Remove=True,
    LimitDistance_m=0.005,
    ZOrientation=X)  # -> Element, Points, Info

# ----
Y = UnitY(Factor=1)
meshtoshell = MeshToShellKaramba3D(Mesh=remesh, CrossSection=cross_section_5, LimitDistance_m=0.005)  # -> Element, Points, Info
subtraction = Subtraction(A=flip_2, B=flip_3)
merge = Merge(Data1=flatten(linetobeam.Element), Data2=flatten(linetobeam_2.Element), Data3=flatten(meshtoshell.Element))
panel_2 = Panel("""10
9
8
7
6
5""")
panel_3 = Panel("""10
9
8
7
6
5""")
item_3 = ListItem(List=panel_2, Index=0, Wrap=True)  # -> Item, Item1, Item2, Item3, Item4, Item5, Item6, Item7, Item8
item_4 = ListItem(List=panel_3, Index=0, Wrap=True)  # -> Item, Item1, Item2, Item3, Item4, Item5, Item6, Item7, Item8
cross_section_6 = CrossSectionKaramba3D(
    FamilyNameOfCrossSection="DefaultCroSec",
    Material=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,
    Height_cm=item_3.Item,
    UpperFlangeWidth_cm=item_3.Item1,
    LowerFlangeWidth_cm=item_3.Item2,
    mode="Trapezoid")
cross_section_7 = CrossSectionKaramba3D(
    FamilyNameOfCrossSection="DefaultCroSec",
    Material=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,
    Height_cm=item_4.Item,
    UpperFlangeWidth_cm=item_4.Item1,
    LowerFlangeWidth_cm=item_4.Item2,
    UpperFlangeThickness_cm=item_4.Item3,
    LowerFlangeThickness_cm=item_4.Item4,
    WebThickness_cm=item_4.Item5,
    FilletRadius_cm=0,
    mode="I")
python = GhPythonScript(x=cross_section_6)  # -> out, a, uf_thick, uf_width, lf_thick, lf_width, height, w_thick
# ---------- python: Python ----------
a = x.shape()


uf_thick = x.uf_thick
uf_width = x.uf_width

w_thick = x.w_thick

height = x.heights()


lf_thick = x.lf_thick
lf_width = x.lf_width

height = x.getHeight()

w_thick = x.w_thick
# ---------- end python ----------
python_2 = GhPythonScript(x=cross_section_7)  # -> out, a, uf_thick, uf_width, lf_thick, lf_width, height, w_thick; same code as python
panel_4 = Panel(python.lf_thick)
panel_5 = Panel(python.uf_thick)
panel_6 = Panel(python.uf_width)
panel_7 = Panel(python.lf_width)
panel_8 = Panel(python.height)
panel_9 = Panel(python.a)
panel_10 = Panel(python_2.uf_thick)
panel_11 = Panel(python_2.uf_width)
panel_12 = Panel(python_2.lf_thick)
panel_13 = Panel(python_2.lf_width)
panel_14 = Panel(python_2.a)
panel_15 = Panel(python_2.height)
panel_16 = Panel("1")  # disabled
number_slider_2 = Slider(357, range=1..800)  # disabled
number_slider_3 = Slider(97, range=1..800)  # disabled
panel_17 = Panel("0.001")  # disabled

# ----
# Position
number_slider_4 = Slider(639, range=0..700)  # disabled
panel_18 = Panel("50")  # disabled
pt_2 = ConstructPoint(XCoordinate=panel_18, YCoordinate=number_slider_4, ZCoordinate=0)  # disabled

number_slider_5 = Slider(2886, range=0..2999)  # disabled
as = AnalysesStepsAlpaca4d(numIncr="1")  # -> AnalysisSteps; inputs numIncr: Int32
# ---------- as: Python ----------
"""
Define the Analysis Step
-
    Inputs:
        numIncr:
        dt:
        dtMin:
        dtMAx:
        Jd:
    Output:
        AnalysisSteps:
"""



ghenv.Component.Name = "Analyses Steps (Alpaca4d)"
ghenv.Component.NickName = 'AS'
ghenv.Component.Message = "Analyses Steps (Alpaca4d)"
ghenv.Component.IconDisplayMode = ghenv.Component.IconDisplayMode.application
ghenv.Component.Category = "Alpaca4d"
ghenv.Component.SubCategory = "7_Analysis"
try: ghenv.Component.AdditionalHelpFromDocStrings = "2"
except: pass


import sys
import Rhino.Geometry as rg
import Grasshopper as gh
import ghpythonlib.components as ghcomp
from System.Drawing import Color

## add alpaca install directory to system path

ghcompfolder = gh.Folders.DefaultAssemblyFolder
if ghcompfolder not in sys.path:
    sys.path.append(ghcompfolder)

try:
    from Alpaca4d import alpaca4d as alpaca
except:
    msg = "Cannot import Alpaca4d. Is the Alpaca4d folder available in " + ghcompfolder + "?"
    ghenv.Component.AddRuntimeMessage(gh.Kernel.GH_RuntimeMessageLevel.Error, msg)

dt = "" if dt is None else dt
dtMin = "" if dtMin is None else dtMin
dtMax = "" if dtMax is None else dtMax
Jd = "" if Jd is None else Jd

checkData = True

if not numIncr:
    checkData = False
    msg = "Input parameter numIncr failed to collect data"
    ghenv.Component.AddRuntimeMessage(gh.Kernel.GH_RuntimeMessageLevel.Warning, msg)

if checkData:
    AnalysisSteps = alpaca.AnalysisSteps(numIncr, dt, dtMin, dtMax, Jd)
# ---------- end as ----------
panel_19 = Panel("5")  # disabled
as_2 = AnalysisSettingsAlpaca4d(AnalysisType="Static", AnalysisSteps=as)  # -> Settings
# ---------- as_2: Python ----------
"""
Create Analysis settings
-
    Args:
        Constraint: 'Plain', 'Transformation'. Default is 'Transformation'.
        Numberer: 'RCM', 'AMD', 'Plain'. Default is 'RCM'.
        System: 'BandGen', 'BandSPD', 'ProfileSPD', 'SuperLU', 'UmfPack', 'FullGeneral', 'SparseSYM'. Default is 'BandSPD'.
        Test: Feature not implemented. Please contact alpaca4d@gmail.com 
        Algorithm: 'Linear', 'Newton', 'NewtonLineSearch', 'ModifiedNewton', 'KrylovNewton', 'SecantNewton', 'BFGS', 'Broyden'. Default is 'Linear'.
        Integrator: Default is LoadControl.
        AnalysisType: 'Static', 'Transient'. Default is 'Static'.
        AnalyesSteps:
    Returns:
        Analysis:
"""

import sys
import os


import clr
import clrtype
import Rhino.Geometry as rg
import rhinoscriptsyntax as rs
import Grasshopper as gh
import copy
import ghpythonlib.treehelpers as th


ghenv.Component.Name = "Analysis settings (Alpaca4d)"
ghenv.Component.NickName = 'AS'
ghenv.Component.Message = "Analysis settings \n(Alpaca4d)"



from Alpaca4d import alpaca4d as alpaca

checkData = True


# default Value
Constraint = 'Transformation' if Constraint is None else Constraint
ConstraintList = ['Plain', 'Transformation']

for item in ConstraintList:
    if Constraint.lower() == item.lower():
        print(item)
        Constraint = item


# default Value
Numberer = 'RCM' if Numberer is None else Numberer
NumbererList = ['RCM', 'AMD', 'Plain', 'ParallelPlain', 'ParallelRCM']

for i,item in enumerate(NumbererList):
    if Numberer.lower() == item.lower():
        Numberer = item



# default Value
System = 'BandSPD' if System is None else System
SystemList = ['BandGen', 'BandSPD', 'ProfileSPD', 'SuperLU', 'UmfPack', 'FullGeneral', 'SparseSYM']

for i,item in enumerate(SystemList):
    if System.lower() == item.lower():
        System = item


# default Test
Test = 'NormDispIncr 1.0e-6 12 5' if Test is None else Test




# default Value
Algorithm = 'Linear' if Algorithm is None else Algorithm
AlgorithmList = ['Linear', 'Newton', 'NewtonLineSearch', 'ModifiedNewton', 'KrylovNewton', 'SecantNewton', 'BFGS', 'Broyden']

for i,item in enumerate(AlgorithmList):
    if Algorithm.lower() == item.lower():
        Algorithm = item


# default Value
AnalysisType = 'Static' if AnalysisType is None else AnalysisType
AnalysisTypeList = ['Static', 'Transient']

for item in AnalysisTypeList:
    if AnalysisType.lower() == item.lower():
        AnalysisType = item


## Define Integrator
if AnalysisType == "Static":
    Integrator = "LoadControl 1.0" if Integrator is None else Integrator
elif AnalysisType == "Transient":
    Integrator = "Newmark 0.5 0.25" if Integrator is None else Integrator



if not AnalysisSteps:
    checkData = False
    msg = "Input parameter AnalysisSteps failed to collect data"
    ghenv.Component.AddRuntimeMessage(gh.Kernel.GH_RuntimeMessageLevel.Warning, msg)


if checkData:
    Settings = alpaca.Analysis(Constraint, Numberer,System,Test,Algorithm,Integrator,AnalysisType, AnalysisSteps)
    print(Settings.write_tcl())
# ---------- end as_2 ----------
clr = ColorsAlpaca4d(gradIndex=11)  # -> reverse(colors); inputs gradIndex: Int32
#   port colors: A series of colors to be plugged into the "Ladybug_Legend Parameters" component.
# ---------- clr: Python ----------
"""
Preset of gradient colors perfect for Data Visualisation
    Inputs:
        gradIndex: An index refering to one of the following possible gradients:
            0 - Orignal Ladybug
            1 - Nuanced Ladybug
            2 - Multi-colored Ladybug
            3 - Ecotect
            4 - Thermal Comfort Percentage
            5 - Thermal Comfort Colors
            6 - Shade Benefit/Harm
            7 - Shade Harm
            8 - Shade Benefit
            9 - CFD Colors 1
            10 - Radiation Benefit
            11 - Gsa10 Colour
            12 - Gsa9 Colour
    Returns:
        customColors: A series of colors.
"""

ghenv.Component.Name = "Colors (Alpaca4d)"
ghenv.Component.NickName = 'CLR'
ghenv.Component.Message = 'Colors (Alpaca4d)'

import scriptcontext as sc
import Grasshopper.Kernel as gh
import System

gradientLibrary = {
        0: [System.Drawing.Color.FromArgb(75, 107, 169), System.Drawing.Color.FromArgb(115, 147, 202), System.Drawing.Color.FromArgb(170, 200, 247), System.Drawing.Color.FromArgb(193, 213, 208), System.Drawing.Color.FromArgb(245, 239, 103), System.Drawing.Color.FromArgb(252, 230, 74), System.Drawing.Color.FromArgb(239, 156, 21), System.Drawing.Color.FromArgb(234, 123, 0), System.Drawing.Color.FromArgb(234, 74, 0), System.Drawing.Color.FromArgb(234, 38, 0)],
        1: [System.Drawing.Color.FromArgb(49,54,149), System.Drawing.Color.FromArgb(69,117,180), System.Drawing.Color.FromArgb(116,173,209), System.Drawing.Color.FromArgb(171,217,233), System.Drawing.Color.FromArgb(224,243,248), System.Drawing.Color.FromArgb(255,255,191), System.Drawing.Color.FromArgb(254,224,144), System.Drawing.Color.FromArgb(253,174,97), System.Drawing.Color.FromArgb(244,109,67), System.Drawing.Color.FromArgb(215,48,39), System.Drawing.Color.FromArgb(165,0,38)],
        2: [System.Drawing.Color.FromArgb(4,25,145), System.Drawing.Color.FromArgb(7,48,224), System.Drawing.Color.FromArgb(7,88,255), System.Drawing.Color.FromArgb(1,232,255), System.Drawing.Color.FromArgb(97,246,156), System.Drawing.Color.FromArgb(166,249,86), System.Drawing.Color.FromArgb(254,244,1), System.Drawing.Color.FromArgb(255,121,0), System.Drawing.Color.FromArgb(239,39,0), System.Drawing.Color.FromArgb(138,17,0)],
        3: [System.Drawing.Color.FromArgb(0,0,255), System.Drawing.Color.FromArgb(53,0,202), System.Drawing.Color.FromArgb(107,0,148), System.Drawing.Color.FromArgb(160,0,95), System.Drawing.Color.FromArgb(214,0,41), System.Drawing.Color.FromArgb(255,12,0), System.Drawing.Color.FromArgb(255,66,0), System.Drawing.Color.FromArgb(255,119,0), System.Drawing.Color.FromArgb(255,173,0), System.Drawing.Color.FromArgb(255,226,0), System.Drawing.Color.FromArgb(255,255,0)],
        4: [System.Drawing.Color.FromArgb(0,0,0), System.Drawing.Color.FromArgb(110,0,153), System.Drawing.Color.FromArgb(255,0,0), System.Drawing.Color.FromArgb(255,255,102), System.Drawing.Color.FromArgb(255,255,255)],
        5: [System.Drawing.Color.FromArgb(0,136,255), System.Drawing.Color.FromArgb(200,225,255), System.Drawing.Color.FromArgb(255,255,255), System.Drawing.Color.FromArgb(255,230,230), System.Drawing.Color.FromArgb(255,0,0)],
        6: [System.Drawing.Color.FromArgb(5,48,97), System.Drawing.Color.FromArgb(33,102,172), System.Drawing.Color.FromArgb(67,147,195), System.Drawing.Color.FromArgb(146,197,222), System.Drawing.Color.FromArgb(209,229,240), System.Drawing.Color.FromArgb(255,255,255), System.Drawing.Color.FromArgb(253,219,199), System.Drawing.Color.FromArgb(244,165,130), System.Drawing.Color.FromArgb(214,96,77), System.Drawing.Color.FromArgb(178,24,43), System.Drawing.Color.FromArgb(103,0,31)],
        7: [System.Drawing.Color.FromArgb(255,255,255), System.Drawing.Color.FromArgb(253,219,199), System.Drawing.Color.FromArgb(244,165,130), System.Drawing.Color.FromArgb(214,96,77), System.Drawing.Color.FromArgb(178,24,43), System.Drawing.Color.FromArgb(103,0,31)],
        8: [System.Drawing.Color.FromArgb(255,255,255), System.Drawing.Color.FromArgb(209,229,240), System.Drawing.Color.FromArgb(146,197,222), System.Drawing.Color.FromArgb(67,147,195), System.Drawing.Color.FromArgb(33,102,172), System.Drawing.Color.FromArgb(5,48,97)],
        9: [System.Drawing.Color.FromArgb(0,16,120), System.Drawing.Color.FromArgb(38,70,160), System.Drawing.Color.FromArgb(5,180,222), System.Drawing.Color.FromArgb(16,180,109), System.Drawing.Color.FromArgb(59,183,35), System.Drawing.Color.FromArgb(143,209,19), System.Drawing.Color.FromArgb(228,215,29), System.Drawing.Color.FromArgb(246,147,17), System.Drawing.Color.FromArgb(243,74,0), System.Drawing.Color.FromArgb(255,0,0)],
        10: [System.Drawing.Color.FromArgb(0,191,48), System.Drawing.Color.FromArgb(255,238,184), System.Drawing.Color.FromArgb(255,0,0)],
        11: [System.Drawing.Color.FromArgb(204,0,71), System.Drawing.Color.FromArgb(255,182,71), System.Drawing.Color.FromArgb(206,255,115), System.Drawing.Color.FromArgb(26,180, 214),System.Drawing.Color.FromArgb(0,0,207)],
        12: [System.Drawing.Color.FromArgb(255, 51, 51), System.Drawing.Color.FromArgb(255, 170, 51), System.Drawing.Color.FromArgb(255, 255, 51), System.Drawing.Color.FromArgb(170, 255, 125), System.Drawing.Color.FromArgb(51, 255, 231), System.Drawing.Color.FromArgb(51, 170, 255), System.Drawing.Color.FromArgb(51,51, 255)]}
colors = gradientLibrary[gradIndex]
# ---------- end clr ----------
panel_20 = Panel(" S")  # disabled
panel_21 = Panel("1")  # disabled
neg = Negative(Value=panel_21)  # disabled
vec_2 = VectorXYZ(XComponent=panel_21, YComponent=panel_21, ZComponent=neg)  # -> Vector, Length; disabled
swatch_2 = ColourSwatch(SwatchColor=RGB(201, 201, 201))  # disabled

geo = Geometry(end.End)
vec_3 = VectorXYZ(XComponent="100", YComponent=0, ZComponent=0)  # -> Vector, Length

cullpt_2 = CullDuplicates(Points=geo, Tolerance=0.1, CullMode=3)  # -> Points, Indices, Valence

loads_2 = LoadsKaramba3D(ForceVector=vec_3.Vector, Local=False, PosInd=cullpt_2.Points, mode="Point")
load = LoadKaramba3D(flatten([loads_2, loads]))

assemble = AssembleModelKaramba3D(Elem=merge, Support=supp, Load=load, LimitDistance_m=0.005)  # -> Model, Info, Mass_kg, CenterOfGravity, LoadCaseNames

crosec_4 = CrossSectionKaramba3D(flatten([filter_2, filter]))
model = ModelKaramba3D(assemble.Model)
opticrosec = OptimizeCrossSectionKaramba3D(
    Model=model,
    CrossSections=crosec_4,
    MaximumUtilization="2.00",
    UltimateLimitStateIterations=5,
    DisplacementIterations=5,
    NumberOfSamplePoints=3,
    ElasticDesign=True,
    GammaM0=1,
    GammaM1=1.1)  # -> ModelWithOptimizedCrossSections, Info, Mass_kg, MaximumDisplacement_cm, ElasticEnergy_kNm

kta = KarambaToAlpacaAlpaca4d(KarambaModel=opticrosec.ModelWithOptimizedCrossSections)  # -> Beams, Shells, Supports, Materials, Loads
# ---------- kta: Python ----------
"""
Convert a Karamba3d model to Alpaca4d
-
    Args:
        KarambaModel:
    Returns:
        Beams:
        Shells:
        Supports:
        Materials:
        Loads:
"""

ghenv.Component.Name = "Karamba to Alpaca (Alpaca4d)"
ghenv.Component.NickName = 'KTA'
ghenv.Component.Message = "Karamba3d to Alpaca4d\n(Alpaca4d)"
ghenv.Component.IconDisplayMode = ghenv.Component.IconDisplayMode.application
ghenv.Component.Category = "Alpaca4d"
ghenv.Component.SubCategory = "Util"



import sys
import clr
import Rhino.Geometry as rg
import Grasshopper as gh
from System.Drawing import Color


## add alpaca install directory to system path

ghcompfolder = gh.Folders.DefaultAssemblyFolder
if ghcompfolder not in sys.path:
    sys.path.append(ghcompfolder)


clr.AddReferenceToFileAndPath("C:\Program Files\Rhino 6\Plug-ins\Karamba\Karamba.gha")
clr.AddReferenceToFileAndPath("C:\Program Files\Rhino 6\Plug-ins\Karamba\KarambaCommon.dll")
clr.AddReferenceToFileAndPath("C:\Program Files\Rhino 7\Plug-ins\Karamba\Karamba.gha")
clr.AddReferenceToFileAndPath("C:\Program Files\Rhino 7\Plug-ins\Karamba\KarambaCommon.dll")


import Karamba
import KarambaCommon
from Karamba.GHopper.Geometry.GeometryExtensions import Convert

try:
    from Alpaca4d import alpaca4d as alpaca
except:
    msg = "Cannot import Alpaca4d. Is the Alpaca4d folder available in " + ghcompfolder + "?"
    ghenv.Component.AddRuntimeMessage(gh.Kernel.GH_RuntimeMessageLevel.Error, msg)


checkData = True

if not KarambaModel:
    checkData = False
    msg = "Input parameter KarambaModel failed to collect data"
    ghenv.Component.AddRuntimeMessage(gh.Kernel.GH_RuntimeMessageLevel.Warning, msg)



if checkData:

    points, lines, meshes, beams, shells, supports, loads, materials, crosecs, joints, logger = KarambaModel.Disassemble()
    
    beamForLocalAxis = KarambaModel.elems # get beams in an other way
    
    
    
    #Create Supports
    
    Supports = []
    
    for item in supports:
        #Pos, Tx = False, Ty = False, Tz = False, Rx = False, Ry = False, Rz = False)
        pos = Convert(item.position)
        Tx, Ty, Tz, Rx, Ry, Rz = item.Condition
        Supports.append( alpaca.Support(pos, Tx, Ty, Tz, Rx, Ry, Rz) )
    
    
    #Create Beams
    
    Beams = []
    Materials = []
    CrossSections = []
    
    for i, item in enumerate(beams):
        
        crossSection = item.crosec
        
        # return Material information
        matName = crossSection.material.name
        E = crossSection.material.E()
        Eneg = 0
        eta = 0
        G = crossSection.material.G3()
        v = crossSection.material.nue12()
        rho = crossSection.material.gamma()
        
        
        secName = crossSection.name
        Area = crossSection.A
        alphaY = crossSection.Ay/Area
        alphaZ = crossSection.Az/Area
        Iyy = crossSection.Iyy
        Izz = crossSection.Izz
        J = crossSection.Ipp
        
        
        GeomTransfType = "Linear"
        Colour = Color.Red
        
        pos = item.Pos.Points()
        Crv = rg.Line( Convert(pos[0]), Convert(pos[1]) ).ToNurbsCurve()
        
        """
        Issue with Local Axis if not assigned
        if item.Ori.IsDefault:
            index = item.fe_id
            
            
            Z_Axis = rg.Vector3d(0.5,0.5,1)
        
        else:
            Z_Axis = Convert(item.Ori.ZOri)
            print(Z_Axis)
        """
        
        material = alpaca.uniAxialMaterialElastic(matName, E, Eneg, eta, G, v, rho*100)
        
        if crossSection.shape() == "O":
            d = crossSection.getHeight()
            t = crossSection.getThickness()
            circleCS = alpaca.CircleCS(d,t,material)
            Section = alpaca.ElasticSection(secName, circleCS.Area(), circleCS.Iyy(), circleCS.Izz(), circleCS.J(), circleCS.alphaY, circleCS.alphaZ, circleCS.material)
            Section.crv = circleCS.crv
            Section.sectionBrep = circleCS.sectionBrep
        
        
        if crossSection.shape() == "I":
            Bsup = crossSection.uf_width
            tsup = crossSection.uf_thick
            Binf = crossSection.lf_width
            tinf = crossSection.lf_thick
            H = crossSection.getHeight()
            tw = crossSection.w_thick
            
            dTCS = alpaca.doubleTCS(Bsup, tsup, Binf, tinf, H, tw, material)
            Section = alpaca.ElasticSection(secName, dTCS.Area(), dTCS.Iyy(), dTCS.Izz(), dTCS.J(), dTCS.alphaY(), dTCS.alphaZ(), dTCS.material)
            Section.crv = dTCS.crv
            Section.sectionBrep = dTCS.sectionBrep
        
    
        if crossSection.shape() == "V":
            # karamba is using b,h in a different way
            h = crossSection.uf_width
            b = crossSection.getHeight()
            rectCS = alpaca.RectangularCS(b,h,material)
            Section = alpaca.ElasticSection(secName, rectCS.Area(), rectCS.Izz(), rectCS.Iyy(), rectCS.J(), rectCS.alphaY, rectCS.alphaZ, rectCS.material)
    
            Section.crv = rectCS.crv
            Section.sectionBrep = rectCS.sectionBrep
    
        # work around to get the axis
        index = beamForLocalAxis[i].fe_id
        febElement = KarambaModel.febmodel.element(index)
        X_Axis = Convert(  beamForLocalAxis[i].localCoSys(febElement)[0] )
        Y_Axis = Convert(  beamForLocalAxis[i].localCoSys(febElement)[1] )
        Z_Axis = Convert(  beamForLocalAxis[i].localCoSys(febElement)[2] )
    
        #use the information to create an Alpaca Element
    
        beam = alpaca.ForceBeamColumn(Crv, Section, GeomTransfType, Colour, Z_Axis)
        
    
    
        
        CrossSections.append(Section)
        Materials.append(material)
        Beams.append(beam)
    
    
    
    Shells = []
    
    
    for item in shells:
        
        karamba_mesh = item.mesh
        vertices = karamba_mesh.Vertices
        face = karamba_mesh.Faces
        
        mesh_geometry= rg.Mesh()
        
        for point in vertices:
            mesh_geometry.Vertices.Add(Convert(point))
        
        for faceOrder in face:
            mesh_geometry.Faces.AddFace(faceOrder.A, faceOrder.B, faceOrder.C)
        
        mesh_geometry.Normals.ComputeNormals()
        
        
        
        crossSection = item.crosec
        
        
        # return Material information
        matName = crossSection.material.name
        E = crossSection.material.E()
        Eneg = 0
        eta = 0
        G = crossSection.material.G3()
        v = crossSection.material.nue12()
        rho = crossSection.material.gamma()
        
        
        #Cross Section
        secName = crossSection.name
        thickness = crossSection.getHeight()
        
        
        # create Alpaca Material
        
        nDMaterial = alpaca.ElasticIsotropic(matName, E, G, rho, v)
        
        # create Alpaca Section
        Section = alpaca.PlateFiberSection(secName, thickness, nDMaterial)
        
        Colour = Color.Blue
        
        mesh_geometry.Unweld(0,True)
        explodedMesh = mesh_geometry.ExplodeAtUnweldedEdges()
        if explodedMesh.Length > 0:
            for mesh in explodedMesh:
                if mesh.Vertices.Count == 3:
                    Shells.append(alpaca.ShellNLDKGT(mesh, Section, Colour))
        elif explodedMesh.Length == 0:
            if mesh_geometry.Vertices.Count == 3:
                Shells = alpaca.ShellNLDKGT(mesh_geometry, Section, Colour)
        
        
        Materials.append(nDMaterial)
    
    
    
    # Convert Load
    
    Loads = []
    
    for load in loads:
        load_type = load.GetType().Name
        if load_type == "PointLoad":
            pos = Convert(load.position)
            force = Convert(load.force)
            moment = rg.Vector3d(0,0,0)
            constant_time_series = alpaca.TimeSeriesConstant(1)
            
            Loads.append( alpaca.PointLoad(pos, force, moment, constant_time_series) )
            
        elif load_type == "GravityLoad":
            constant_time_series = alpaca.TimeSeriesConstant(1)
            
            Loads.append( alpaca.GravityLoad(1, constant_time_series ))
# ---------- end kta ----------
cts = ConstantTimeSeriesAlpaca4d()  # -> TimeSeries, Graph
# ---------- cts: Python ----------
"""
Create a Constant Time Series
-
    Args:
        tStart:
        tEnd:
        period:
        factor:
        shift:
    Returns:
        TimeSeries:
        Graph:
"""

ghenv.Component.Name = "Constant Time Series (Alpaca4d)"
ghenv.Component.NickName = 'CTS'
ghenv.Component.Message = "Constant Time Series (Alpaca4d)"


import sys
import Rhino.Geometry as rg
import Grasshopper as gh
import copy
import math


## add alpaca install directory to system path

ghcompfolder = gh.Folders.DefaultAssemblyFolder
if ghcompfolder not in sys.path:
    sys.path.append(ghcompfolder)

try:
    from Alpaca4d import alpaca4d as alpaca
except:
    msg = "Cannot import Alpaca4d. Is the Alpaca4d folder available in " + ghcompfolder + "?"
    ghenv.Component.AddRuntimeMessage(gh.Kernel.GH_RuntimeMessageLevel.Error, msg)

def ConstantSeries(x):
    return x



checkData = True

if not constantFactor:
    constantFactor = 1


if checkData:
    TimeSeries = alpaca.TimeSeriesConstant(constantFactor)
    
    Graph = []
    
    for x in range(10):
        Graph.append(ConstantSeries(constantFactor))
# ---------- end cts ----------
pt_3 = Point(flatten(cullpt_2.Points))
vec_4 = Vector(vec_3.Vector)
pl = PointLoadAlpaca4d(Pos=pt_3, Force=vec_4, TimeSeries=cts.TimeSeries)  # -> out, Load; inputs Pos: Point3d, Force: Vector3d, Moment: Vector3d
# ---------- pl: Python ----------
"""
Create a Point Load
-
    Args:
        Pos:
        Force:
        Moment:
        TimeSeries:
    Returns:
        PointLoad:
"""

ghenv.Component.Name = "Point Load (Alpaca4d)"
ghenv.Component.NickName = 'PL'
ghenv.Component.Message = "Point Load (Alpaca4d)"



import sys
import Rhino.Geometry as rg
import Grasshopper as gh
import copy


## add alpaca install directory to system path

ghcompfolder = gh.Folders.DefaultAssemblyFolder
if ghcompfolder not in sys.path:
    sys.path.append(ghcompfolder)

try:
    from Alpaca4d import alpaca4d as alpaca
except:
    msg = "Cannot import Alpaca4d. Is the Alpaca4d folder available in " + ghcompfolder + "?"
    ghenv.Component.AddRuntimeMessage(gh.Kernel.GH_RuntimeMessageLevel.Error, msg)


checkData = True

if not Pos:
    checkData = False
    msg = "Input parameter Pos failed to collect data"
    ghenv.Component.AddRuntimeMessage(gh.Kernel.GH_RuntimeMessageLevel.Warning, msg)

if not Force:
    Force = rg.Vector3d(0,0,0)

if not Moment:
    Moment = rg.Vector3d(0,0,0)

if not TimeSeries:
    checkData = False
    msg = "Input parameter TimeSeries failed to collect data"
    ghenv.Component.AddRuntimeMessage(gh.Kernel.GH_RuntimeMessageLevel.Warning, msg)


if checkData:
    Load = alpaca.PointLoad(Pos, Force, Moment, TimeSeries)
# ---------- end pl ----------
am = AssembleModelAlpaca4d(Element=flatten([kta.Beams, kta.Shells]), Support=kta.Supports, Load=flatten(pl.Load))  # -> out, AlpacaModel, Mass; inputs Element: list, Support: list, Load: list, Constraint: list
# ---------- am: Python ----------
"""
Create a FEA Model
-
    Args:
        Element:
        Support:
        Load:
        Constraint:
    Returns:
        AlpacaModel:
"""


import os
import sys
import ghpythonlib.treehelpers as th
import Rhino.Geometry as rg
import Rhino.Collections as rc
import rhinoscriptsyntax as rs
from collections import defaultdict, OrderedDict
import copy
import time
import Grasshopper as gh


ghenv.Component.Name = "Assemble Model (Alpaca4d)"
ghenv.Component.NickName = 'AM'
ghenv.Component.Message = "Assemble Model (Alpaca4d)"


## add alpaca install directory to system path

ghcompfolder = gh.Folders.DefaultAssemblyFolder
if ghcompfolder not in sys.path:
    sys.path.append(ghcompfolder)

try:
    from Alpaca4d import alpaca4d as alpaca
except:
    msg = "Cannot import Alpaca4d. Is the Alpaca4d folder available in " + ghcompfolder + "?"
    ghenv.Component.AddRuntimeMessage(gh.Kernel.GH_RuntimeMessageLevel.Error, msg)


checkData = True

if not Element:
    checkData = False
    msg = "Input parameter Element failed to collect data"
    ghenv.Component.AddRuntimeMessage(gh.Kernel.GH_RuntimeMessageLevel.Warning, msg)

if not Support:
    checkData = False
    msg = "Input parameter Support failed to collect data"
    ghenv.Component.AddRuntimeMessage(gh.Kernel.GH_RuntimeMessageLevel.Warning, msg)


if checkData:
    
    FolderPath = rs.DocumentPath()
    os.chdir(FolderPath)
    
    # create the object model
    AlpacaModel = alpaca.Model()
    
    
    start = time.clock()
    #subdivide element per type
    
    for element in Element:
        if element.type == "Beam":
            AlpacaModel.beams.append(element)
        elif element.type == "Shell":
            AlpacaModel.shells.append(element)
        elif element.type == "Brick":
            AlpacaModel.bricks.append(element)
    
    
    end = time.clock() - start
    print("time to subdivide element {}".format(end))
    start = time.clock()
    
    # create a list of unique point
    # need to add the rigid constraint
    
    AlpacaModel.getuniquePoints(AlpacaModel.beams, AlpacaModel.shells, AlpacaModel.bricks, Constraint)
    
    
    end = time.clock() - start
    print("time to get uniquepoints {}".format(end))
    start = time.clock()
    
    
    #############
    # create node and assign to object
    #############
    
    if AlpacaModel.uniquePointsThreeNDF:
        AlpacaModel.py.append(alpaca.Model.write3ndf_tcl())
        for point in AlpacaModel.uniquePointsThreeNDF:
            node = alpaca.Node(point)
            node.ndf = 3
            node.setNodeTag(AlpacaModel)
            AlpacaModel.nodes.append( node )
        
            AlpacaModel.py.append(node.write_tcl())
    
    
    if AlpacaModel.uniquePointsSixNDF:
        AlpacaModel.py.append(alpaca.Model.write6ndf_tcl())
        for point in AlpacaModel.uniquePointsSixNDF:
            node = alpaca.Node(point)
            node.ndf = 6
            node.setNodeTag(AlpacaModel)
            AlpacaModel.nodes.append( node )
         
            AlpacaModel.py.append(node.write_tcl())
    
    
    
    end = time.clock() - start
    print("time to create node and assign tag {}".format(end))
    start = time.clock()
    
    
    #################
    # create supports
    #################
    
    for supportNode in Support:
        
        # if the list is empty, skip this operation
        if AlpacaModel.uniquePointsThreeNDF:
            closestPointInThreeNDF = rc.Point3dList.ClosestPointInList(AlpacaModel.uniquePointsThreeNDF, supportNode.Pos)
            if supportNode.Pos.DistanceTo(closestPointInThreeNDF) < 0.001:
                #print("I am in 3ndf")
                supportNode.ndf = 3
                AlpacaModel.threeNDFModel.append(supportNode)
                supportNode.setNodeTag(AlpacaModel)
        
        if AlpacaModel.uniquePointsSixNDF:
            closestPointInSixNDF = rc.Point3dList.ClosestPointInList(AlpacaModel.uniquePointsSixNDF, supportNode.Pos)
            if supportNode.Pos.DistanceTo(closestPointInSixNDF) < 0.001:
                supportNode.ndf = 6
                AlpacaModel.sixNDFModel.append(supportNode)
                supportNode.setNodeTag(AlpacaModel)
        
        
        AlpacaModel.supports.append(supportNode)
        AlpacaModel.py.append(supportNode.write_tcl())
    
    
    end = time.clock() - start
    print("time to create support and assign tag {}".format(end))
    start = time.clock()
    
    
    ####################
    # create constraints
    ####################
    
    
    for constraint in Constraint:
        constraint.setNodeTag(AlpacaModel)
        AlpacaModel.constraints.append(constraint)
    
    ####################
    # create equalDOF when the model has 3df and 6df together
    ####################
    
    
    end = time.clock() - start
    print("time to create constraint and assign tag {}".format(end))
    start = time.clock()
    
    
    Id = []
    IdB = []
    
    def SearchCallback(sender, e):
        Id.Add(e.Id)
        IdB.Add(e.IdB)
    
    
    
    lenThreeNDF = len(AlpacaModel.uniquePointsThreeNDF)
    lenSixNDF = len(AlpacaModel.uniquePointsSixNDF)
    
    
    if not(lenThreeNDF == 0 or lenSixNDF == 0):
        print("brick and beam together")
        rg.RTree.SearchOverlaps(AlpacaModel.RTreeCloudPointThreeNDF, AlpacaModel.RTreeCloudPointSixNDF, 0.001, SearchCallback)
        
        for i,j in zip(Id, IdB):
            print(i,j)
            node_i = AlpacaModel.uniquePointsThreeNDF[i]
            node_j = AlpacaModel.uniquePointsSixNDF[j]
            
            #index_i = AlpacaModel.cloudPoint.ClosestPoint(node_i) + 1
            #index_j = AlpacaModel.cloudPoint.ClosestPoint(node_j) + 1
            
            equalConstraint = alpaca.EqualDOF(node_i, node_j, True, True, True, False, False, False)
            equalConstraint.masterNodeTag = AlpacaModel.cloudPointThreeNDF.ClosestPoint(node_i) + 1
            equalConstraint.slaveNodesTag = AlpacaModel.cloudPointSixNDF.ClosestPoint(node_j) + 1 + len(AlpacaModel.uniquePointsThreeNDF)
            AlpacaModel.py.append(equalConstraint.write_tcl())
    
    
    
    end = time.clock() - start
    print("time to find common points between 3ndf and 6ndf {}".format(end))
    start = time.clock()
    
    ##########################
    ##########################
    ##########################
    
    crossSection = []
    material = []
    
    for item in Element:
        crossSection.append(item.CrossSection)
        material.append(item.CrossSection.material)
    
    uniqueCS = list(set(crossSection))
    uniqueMaterial = list(set(material))
    
    for index, material in enumerate(uniqueMaterial,1):
        material.matTag = index
        AlpacaModel.py.append(material.write_tcl())
    
    
    for index, section in enumerate(uniqueCS,1):
        section.sectionTag = index
        AlpacaModel.py.append(section.write_tcl())
        
    
    
    
    
    
    # write py file
    
    
    # assign tag and node Index to element and shell
    for index, element in enumerate(Element,1):
        element.setTopologyRTree(AlpacaModel)
        element.eleTag = index
        element.setTags()
    
    
    
    end = time.clock() - start
    print("time to assign tags for the elements {}".format(end))
    start = time.clock()
    
    
    
    Mass = 0
    IsGravity = False
    
    for item in Load:
        if item.type == "Gravity Load":
            IsGravity = True
            GravityLoad = item
        if item.type == "PointLoad":
            AlpacaModel.loads.append(item)
    
    
    for item in Element:
        if item.type == "Beam":
            length = item.Crv.GetLength()
            Mass += (item.massDens * length)
            if IsGravity:
                gravityPointLoad = alpaca.PointLoad(item.Crv.PointAtStart, rg.Vector3d(0,0, -(item.massDens * length / 2)) * GravityLoad.GravityFactor, rg.Vector3d(0,0,0), GravityLoad.TimeSeries)
                #print( -(item.massDens * length / 2))
                AlpacaModel.loads.append(gravityPointLoad)
        if item.type == "Shell":
            meshArea = rg.AreaMassProperties.Compute(item.Mesh).Area
            areaDensity = item.CrossSection.thickness * item.CrossSection.material.rho
            Mass += areaDensity * meshArea
            if IsGravity:
                for vertex in item.Mesh.Vertices.ToPoint3dArray():
                    gravityPointLoad = alpaca.PointLoad(vertex, rg.Vector3d(0,0, -(areaDensity * meshArea/ len(item.Mesh.Vertices))) * GravityLoad.GravityFactor, rg.Vector3d(0,0,0), GravityLoad.TimeSeries)
                    AlpacaModel.loads.append(gravityPointLoad)
        if item.type == "Brick":
            #print(type(item.Mesh))
            meshVolume = rg.VolumeMassProperties.Compute(item.Mesh).Volume
            density = item.material.rho 
            Mass += density * meshVolume
            if IsGravity:
                for vertex in item.Mesh.Vertices.ToPoint3dArray():
                    gravityPointLoad = alpaca.PointLoad(vertex, rg.Vector3d(0,0, -(density * meshVolume / len(item.Mesh.Vertices))) * GravityLoad.GravityFactor, rg.Vector3d(0,0,0), GravityLoad.TimeSeries)
                    #print(len(item.Mesh.Vertices))
                    #print(density)
                    # volume can be zero if mesh faces are not properly rotated
                    #print(meshVolume)
                    #print(-(density * meshVolume / len(item.Mesh.Vertices)))
                    AlpacaModel.loads.append(gravityPointLoad)
    
    #print(AlpacaModel.loads)
    ## load
    
    
    for item in AlpacaModel.loads:
        item.setNodeTag(AlpacaModel)
    
    #print(AlpacaModel.loads)
    
    for item in AlpacaModel.beams:
        print(type(item))
        AlpacaModel.py.append(item.write_tcl())
    
    for item in AlpacaModel.shells:
        AlpacaModel.py.append(item.write_tcl())
    
    for item in AlpacaModel.bricks:
        AlpacaModel.py.append(item.write_tcl())
    
    
    for item in Constraint:
        AlpacaModel.py.append(item.write_tcl())
    
    
    timeSeriesDict = alpaca.TimeSeries.getTimeSeries(AlpacaModel.loads)[1]
    AlpacaModel.py.append(alpaca.PointLoad.write_tcl(timeSeriesDict,AlpacaModel))
    
    
    text = AlpacaModel.py
# ---------- end am ----------

ds_2 = DisassembleModelAlpaca4d(AlpacaModel=am.AlpacaModel)  # -> out, Points, threeNdfPoints, sixNdfPoints, Beam, Shell, Brick, Support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
# ---------- ds_2: Python ----------
"""
Disassemble a Model
-
    Args:
        AlpacaModel:
    Returns:
        Points:
        threeNdfPoints:
        sixNdfPoints:
        
        Beam:
        Shell:
        Brick:
        Support:
        Constraint:
        TimeSeries:
        Load:
        Material:
"""

ghenv.Component.Name = "Disassemble Model (Alpaca4d)"
ghenv.Component.NickName = 'DS'
ghenv.Component.Message = "Disassemble Model (Alpaca4d)"


import sys
import Rhino.Geometry as rg
import Grasshopper as gh


## add alpaca install directory to system path

ghcompfolder = gh.Folders.DefaultAssemblyFolder
if ghcompfolder not in sys.path:
    sys.path.append(ghcompfolder)

try:
    from Alpaca4d import alpaca4d as alpaca
except:
    msg = "Cannot import Alpaca4d. Is the Alpaca4d folder available in " + ghcompfolder + "?"
    ghenv.Component.AddRuntimeMessage(gh.Kernel.GH_RuntimeMessageLevel.Error, msg)

checkData = True


if not AlpacaModel:
    checkData = False
    msg = "Input parameter AlpacaModel failed to collect data"
    ghenv.Component.AddRuntimeMessage(gh.Kernel.GH_RuntimeMessageLevel.Warning, msg)

if checkData:
    Points = AlpacaModel.uniquePoints
    threeNdfPoints = AlpacaModel.uniquePointsThreeNDF
    sixNdfPoints = AlpacaModel.uniquePointsSixNDF
    
    Beam = AlpacaModel.beams
    Shell  = AlpacaModel.shells
    Brick = AlpacaModel.bricks
    Support = AlpacaModel.supports
    Constraint = AlpacaModel.constraints
    TimeSeries = AlpacaModel.timeSeries
    Load = AlpacaModel.loads
    Material = AlpacaModel.materials
# ---------- end ds_2 ----------
data = Data(assemble.Mass_kg)
data_2 = Data(am.Mass)
karamba_mass = Panel(data)
alpaca_mass = Panel(data_2)
ra = RunAnalysisAlpaca4d(AlpacaModel=am.AlpacaModel, Settings=as_2)  # -> log, AlpacaSolvedModel
# ---------- ra: Python ----------
"""
Run an OpenSees Analysis
-
    Args:
        AlpacaModel:
        Settings:
    Returns:
        AlpacaSolvedModel:
"""



import Rhino.RhinoDoc
import Grasshopper as gh
import copy
import rhinoscriptsyntax as rs
import os
import time
import sys



ghenv.Component.Name = "Run Analysis (Alpaca4d)"
ghenv.Component.NickName = 'RA'
ghenv.Component.Message = "Run Analysis (Alpaca4d)"

ghcompfolder = gh.Folders.DefaultAssemblyFolder
if ghcompfolder not in sys.path:
    sys.path.append(ghcompfolder)

try:
    from Alpaca4d import alpaca4d as alpaca
except:
    msg = "Cannot import Alpaca4d. Is the Alpaca4d folder available in " + ghcompfolder + "?"
    ghenv.Component.AddRuntimeMessage(gh.Kernel.GH_RuntimeMessageLevel.Error, msg)


checkData = True



if not AlpacaModel:
    checkData = False
    msg = "Input parameter AlpacaModel failed to collect data"
    ghenv.Component.AddRuntimeMessage(gh.Kernel.GH_RuntimeMessageLevel.Warning, msg)


if not Settings:
    checkData = False
    msg = "Input parameter Settings failed to collect data"
    ghenv.Component.AddRuntimeMessage(gh.Kernel.GH_RuntimeMessageLevel.Warning, msg)


if checkData:
    FolderPath = rs.DocumentPath()
    os.chdir(FolderPath)
    
    outputFileName = 'openSeesModel'
    recorderFileName = 'recorder.mpco'
    
    for dirpath, dirnames, filenames in os.walk(FolderPath):
        for filename in filenames:
            if filename == outputFileName:
                file = os.path.join(dirpath,outputFileName)
                os.remove(file)
            elif filename == recorderFileName:
                file = os.path.join(dirpath,recorderFileName)
                os.remove(file)
    
    
    # create a copy
    
    AnalysisModel = copy.copy(AlpacaModel)
    AnalysisModel.py = list(AnalysisModel.py)
    
    # generate Recorder and assign name
    AnalysisModel.recorderName = "recorder" + ".mpco"
    
    AnalysisModel.py.append(alpaca.TCLRecorder.mpco(AnalysisModel.recorderName, True,True,True,True,False,False,True,True,True,True))
    
    
    AnalysisModel.analysis = Settings
    AnalysisModel.py.append(Settings.write_tcl())
    AnalysisModel.py.append("wipe")
    
    
    #textFile = AnalysisModel.py
    
    time_start = time.clock()
    
    AnalysisModel.writeFile(outputFileName)
    
    time_elapsed = (time.clock() - time_start)
    print("Writing Time {}".format(time_elapsed))
    
    
    
    time_start = time.clock()
    
    executable = os.path.join(ghcompfolder,'Alpaca4d\OpenSees-Solvers\opensees.bat')
    a, log = AnalysisModel.runOpensees(executable)
    
    
    time_elapsed = (time.clock() - time_start)
    print("Analyses Time {}".format(time_elapsed))
    
    AlpacaSolvedModel = copy.copy(AnalysisModel)
    AlpacaSolvedModel.isAnalysed = True
# ---------- end ra ----------
vm = ViewModelAlpaca4d(AlpacaModel=am.AlpacaModel, type=Toggle(True), support=Toggle(True))  # inputs type: Boolean, nodeTag: Boolean, eleTag: Boolean, localAxis: Boolean, support: Boolean, load: Boolean
# ---------- vm: Python ----------
"""View structural Model
    Inputs:
        AlpacaModel: Output of Assemble Model.
        type: Style of visualize Model 
Default: Visualize the stick Model
True: Visualize the extrude Model
        nodeTag: 
True: Visualize tag nodes
        eleTag: 
True: Visualize tag elements 
        LocalAxes:
True: Visualize local Axis of elements 
        Support: 
True: Visualize support type
        Load: 
True: Visualize load
"""


from ghpythonlib.componentbase import executingcomponent as component
import Grasshopper, GhPython
import System
import ghpythonlib.components as ghcomp

import Rhino as rc
import rhinoscriptsyntax as rs
import sys
import Rhino.Geometry as rg
import Grasshopper as gh
import copy

ghenv.Component.Name = "View Model (Alpaca4d)"
ghenv.Component.NickName = 'VM'
ghenv.Component.Message = "View Model (Alpaca4d)"

ghcompfolder = gh.Folders.DefaultAssemblyFolder
if ghcompfolder not in sys.path:
    sys.path.append(ghcompfolder)
try:
    from Alpaca4d import alpaca4dView as alpacaView
except:
    msg = "Cannot import Alpaca4d. Is the Alpaca4d folder available in " + ghcompfolder + "?"
    ghenv.Component.AddRuntimeMessage(gh.Kernel.GH_RuntimeMessageLevel.Error, msg)

checkData = True

class MyComponent(component):
    
    def RunScript(self, AlpacaModel, type, nodeTag, eleTag, localAxis, support, load):
        
        
        self.ModelBeam = []
        self.ModelShell = []
        self.ModelBrick = []
        self.Nodes = []
        self.TagEle = []
        self.localAxis = []
        self.solidSupport = []
        self.viewLoad = []
        
        if not AlpacaModel:
            checkData = False
            msg = "Input parameter AlpacaModel failed to collect data"
            ghenv.Component.AddRuntimeMessage(gh.Kernel.GH_RuntimeMessageLevel.Warning, msg)
        else:
            self.type = type
            
            ## add alpaca install directory to system path
            
            self.ModelBeam = alpacaView.ViewBeam( AlpacaModel, type)
            self.ModelShell = alpacaView.ViewShell( AlpacaModel, type )
            self.ModelBrick = alpacaView.ViewBrick( AlpacaModel)
            #NODE TAG VIEW
            if nodeTag is True:
                self.Nodes = [ [inode.nodeTag, inode.Pos] for inode in AlpacaModel.nodes]
            else:
                self.Nodes = []
            #ELE TAG VIEW
            if eleTag is True:
                TagBeam = [ [item.eleTag, item.getPerpFrame().Origin] for item in AlpacaModel.beams]
                TagShell = [ [item.eleTag, rg.AreaMassProperties.Compute( item.Mesh, False, True, False, False ).Centroid] for item in AlpacaModel.shells]
                TagBrick = [ [item.eleTag, rg.AreaMassProperties.Compute( item.Mesh, False, True, False, False ).Centroid] for item in AlpacaModel.bricks]
                self.TagEle = TagBeam + TagShell + TagBrick
            else:
                self.TagEle = []
            #LOCAL AXIS
            if localAxis is True:
                self.localAxis = [ [item.getPerpFrame().Origin, item.getPerpFrame().XAxis, item.getPerpFrame().YAxis, item.getPerpFrame().ZAxis]   for item in AlpacaModel.beams]
    
                for item in AlpacaModel.shells:
                    item.Mesh.Normals.ComputeNormals()
                    i = item.Mesh.Vertices[0]
                    j = item.Mesh.Vertices[1]
                    curve = rg.LineCurve( i, j )
                    midPoint = rg.AreaMassProperties.Compute( item.Mesh, False, True, False, False ).Centroid
                    vector3 = item.Mesh.Normals.Item[0]
                    vector1 = rg.Curve.PerpendicularFrameAt( curve, 0 )[1].ZAxis
                    vector2 = rg.Vector3d.CrossProduct( vector3, vector1)
                    self.localAxis.append( [midPoint, ghcomp.UnitVector(vector1), ghcomp.UnitVector(vector2), ghcomp.UnitVector(vector3)] )
                
                for item in AlpacaModel.bricks:
                    FaceNormals = ghcomp.FaceNormals(item.Mesh)
                    midPoint = FaceNormals[0]
                    normals = FaceNormals[1]
                    face = item.Mesh.Faces
                    curve = []
                    for iFace in face:
                        i = item.Mesh.Vertices[iFace[0]]
                        j = item.Mesh.Vertices[iFace[1]]
                        curve.append( rg.LineCurve( i, j ) )
                    for iM, iN, iC in zip(midPoint, normals, curve):
                        vector3 = iN
                        vector1 = rg.Curve.PerpendicularFrameAt( iC, 0 )[1].ZAxis
                        vector2 = rg.Vector3d.CrossProduct( vector3, vector1)
                        self.localAxis.append( [iM, ghcomp.UnitVector(vector1), ghcomp.UnitVector(vector2), ghcomp.UnitVector(vector3)] )
                
            else:
                self.localAxis = []
            #SUPPORT
            if support is True:
                scale = 0.5
                self.solidSupport = [ alpacaView.Support( iSupport, scale ) for iSupport in AlpacaModel.supports ]
            else:
                self.solidSupport = []
            # LOAD
            if load is True:
                self.viewLoad =[[item.Pos, item.Force, item.Moment] for item in AlpacaModel.loads]
            else:
                self.viewLoad = []
            self.forceBounds = ghcomp.Bounds([ item[1] for item in self.viewLoad])
            self.momentBounds = ghcomp.Bounds([ item[2] for item in self.viewLoad])

    def DrawViewportWires(self,arg):
        # Beam
        for iBeam in self.ModelBeam:
            color = iBeam[1]
            colorMaterial = rc.Display.DisplayMaterial(color, 0.3)
            if self.type is True:
                colorWirframe = System.Drawing.Color.Gray
                #System.Drawing.Color.LightGray
                arg.Display.DrawBrepShaded(iBeam[0], colorMaterial)
                arg.Display.DrawBrepWires(iBeam[0], colorWirframe)
            else :
                thickness =2
                arg.Display.DrawCurve(iBeam[0], color, thickness)
        # Mesh
        for iShell in self.ModelShell:
            color = iShell[1]
            #color = System.Drawing.Color.Blue
            colorMaterial = rc.Display.DisplayMaterial(color,color,color,color,1,0.30)
            colorMaterial.IsTwoSided = False
            arg.Display.DrawMeshShaded(iShell[0], colorMaterial)
            colorWirframe = System.Drawing.Color.Black
            arg.Display.DrawMeshWires(iShell[0], colorWirframe)
        #Brick 
        for iBrick in self.ModelBrick:
            color = iBrick[1]
            #color = System.Drawing.Color.Blue
            colorMaterial = rc.Display.DisplayMaterial(color,color,color,color,1,0.30)
            colorMaterial.IsTwoSided = False
            arg.Display.DrawMeshShaded(iBrick[0], colorMaterial)
            colorWirframe = System.Drawing.Color.Black
            arg.Display.DrawMeshWires(iBrick[0], colorWirframe)
            
        # node Tag view
        for inode in self.Nodes:
            arg.Display.Draw2dText( str(inode[0]), System.Drawing.Color.DarkSlateBlue, inode[1], True, 50)
        # ele Tag view
        for iEle in self.TagEle:
            arg.Display.Draw2dText( str(iEle[0]), System.Drawing.Color.BlanchedAlmond, iEle[1], True, 50)
        # local Axis
        for iLocalAxis in self.localAxis:
            c = 0.25
            arg.Display.DrawArrow( rg.Line(iLocalAxis[0], rg.Vector3d.Multiply(c,iLocalAxis[1])), System.Drawing.Color.Red)
            arg.Display.DrawArrow( rg.Line(iLocalAxis[0], rg.Vector3d.Multiply(c,iLocalAxis[2])), System.Drawing.Color.Green)
            arg.Display.DrawArrow( rg.Line(iLocalAxis[0], rg.Vector3d.Multiply(c,iLocalAxis[3])), System.Drawing.Color.Blue)
            
            
        color = System.Drawing.Color.Azure
        colorWirframe = System.Drawing.Color.Black
        colorMaterial = rc.Display.DisplayMaterial(color, 0.0)
        for iSupport in self.solidSupport :
            arg.Display.DrawBrepShaded( iSupport, colorMaterial)
            arg.Display.DrawBrepWires( iSupport, colorWirframe)
            
        for iLoad in self.viewLoad:
            arg.Display.DrawArrow( rg.Line(iLoad[0], iLoad[1]/self.forceBounds[1]) ,  System.Drawing.Color.DarkRed)
            arg.Display.DrawArrow( rg.Line(iLoad[0], iLoad[2]/self.momentBounds[1]) ,  System.Drawing.Color.DarkBlue)
# ---------- end vm ----------
dm = DeformedModelAlpaca4d(AlpacaSolvedModel=ra.AlpacaSolvedModel, scale="0.00", extrudeModel=Toggle(True), listColor=clr)  # -> DefModel, bounds; inputs step: Int32, extrudeModel: Boolean, typeColor: Int32, listColor: list of Color
# ---------- dm: Python ----------
"""View Deformed model
    Args:
        AlpacaSolvedModel: Output of Analyses solver
        step:
        scale: Multiplication factor for displacement
        extrudeModel:  
True : view extruded model
else : view stick model
        typeColor:  View relative color of the traslation
<=0 : view traslation X 
1 : view traslation Y
2 : view traslation Z
>= 3 : view resulting displacement.
        listColor : one list of color 

    Output:
       DefModel: view deformed model
       bounds: max end min of displacement of the structure 
"""

ghenv.Component.Name = "Deformed Model (Alpaca4d)"
ghenv.Component.NickName = 'DM'
ghenv.Component.Message = "Deformed Model (Alpaca4d)"

from ghpythonlib.componentbase import executingcomponent as component
import System
import rhinoscriptsyntax as rs

import sys
import os
import clr
import clrtype
import Rhino.Geometry as rg
import Rhino as rc
import math as mt
import Grasshopper as gh
import ghpythonlib.treehelpers as th
from ghpythonlib.components import ConstructDomain

ghcompfolder = gh.Folders.DefaultAssemblyFolder
if ghcompfolder not in sys.path:
    sys.path.append(ghcompfolder)
try:
    from Alpaca4d import alpaca4dView as alpacaView
except:
    msg = "Cannot import Alpaca4d. Is the Alpaca4d folder available in " + ghcompfolder + "?"
    ghenv.Component.AddRuntimeMessage(gh.Kernel.GH_RuntimeMessageLevel.Error, msg)
    
FolderPath = rs.DocumentPath()
os.chdir(FolderPath)

ghcompfolder = gh.Folders.DefaultAssemblyFolder
my_module_name = "Alpaca_StepReader"
my_module = sys.modules.setdefault(my_module_name, type(sys)(my_module_name))


try:
    Steps_dm = my_module.Steps_dm
    Modes = my_module.Modes
except AttributeError:
    type_2d = type(System.Array.CreateInstance(float, 1, 1))

    class Steps_dm(object):
        __metaclass__ = clrtype.ClrClass
        _clrfields = {"STEP_{}".format(i): type_2d for i in range(1000)} # it will work for model with less than 1000 steps

    class Modes(object):
        __metaclass__ = clrtype.ClrClass
        _clrfields = {"MODE_{}".format(i): type_2d for i in range(1000)} # it will work for model with less than 1000 steps

    my_module.Steps_dm = Steps_dm
    my_module.Modes = Modes


hdfFilePath = os.path.join(ghcompfolder, "Alpaca4d\HDF5CSharp.dll")
clr.AddReferenceToFileAndPath(hdfFilePath)

from HDF5CSharp import Hdf5

class MyComponent(component):
    
    def RunScript(self, AlpacaSolvedModel, step = None, scale = None , extrudeModel = None, typeColor = None, listColor = [] ):
        import sys
        
        self.extrudeModel = extrudeModel
        
        self.defModel1 = []
        self.defModel2 = []
        self.defModel3 = []
        
        self.beamColor = []
        

        if step == None:
            step = 0
        if extrudeModel == None:
            extrudeModel = False
        if typeColor == None:
            typeColor = 3
        
        if not listColor: listColor = [ System.Drawing.Color.DarkViolet, 
                                        System.Drawing.Color.BlueViolet, 
                                        System.Drawing.Color.RoyalBlue, 
                                        System.Drawing.Color.CornflowerBlue,
                                        System.Drawing.Color.LightSkyBlue, 
                                        System.Drawing.Color.LightBlue,
                                        System.Drawing.Color.CadetBlue,
                                        System.Drawing.Color.LightGreen,
                                        System.Drawing.Color.GreenYellow,
                                        System.Drawing.Color.Yellow,
                                        System.Drawing.Color.Orange,
                                        System.Drawing.Color.Red,
                                        System.Drawing.Color.DarkRed]
            
        checkData = True
        
        if not AlpacaSolvedModel:
            checkData = False
            msg = "Input parameter AlpacaSolvedModel failed to collect data"
            ghenv.Component.AddRuntimeMessage(gh.Kernel.GH_RuntimeMessageLevel.Warning, msg)
        else:
            try:
                fileId = Hdf5.OpenFile(AlpacaSolvedModel.recorderName, True)
                print( AlpacaSolvedModel.recorderName)
                numberOfPoints = len(AlpacaSolvedModel.uniquePoints) #
                
                displacement = []
                rotation = []
                dispNodeList = []
                
                if AlpacaSolvedModel.isModal == True:
                    print( AlpacaSolvedModel.isModal == True )
                    outputData = "MODEL_STAGE[1]/RESULTS/ON_NODES/MODES_OF_VIBRATION(U)/DATA/STEP_0"
                    print( outputData )
                    displacementResult = Hdf5.ReadObject[Modes](fileId, outputData)
                    for i in range(numberOfPoints):
                        tag = i + 1
                        vx = getattr(displacementResult, 'MODE_{}'.format(step))[i,0]
                        vy = getattr(displacementResult, 'MODE_{}'.format(step))[i,1]
                        vz = getattr(displacementResult, 'MODE_{}'.format(step))[i,2]
                        trasl = rg.Vector3d(vx,vy,vz)
                        displacement.append(trasl)
                        dispNodeList.append( [tag, trasl] )
                        
                    Hdf5.CloseFile(fileId)
                    print("I have closed the file")
                else: 
                    outputData = "/MODEL_STAGE[1]/RESULTS/ON_NODES/DISPLACEMENT/DATA"
                    print( outputData )
                    displacementResult = Hdf5.ReadObject[Steps_dm](fileId, outputData)
                    for i in range(numberOfPoints):
                        tag = i + 1
                        vx = getattr(displacementResult, 'STEP_{}'.format(step))[i,0]
                        vy = getattr(displacementResult, 'STEP_{}'.format(step))[i,1]
                        vz = getattr(displacementResult, 'STEP_{}'.format(step))[i,2]
                        trasl = rg.Vector3d(vx,vy,vz)
                        displacement.append(trasl)
                        dispNodeList.append( [tag, trasl] )
                        
                    Hdf5.CloseFile(fileId)
                    print("I have closed the file")
            
                dispNodeDict = dict( dispNodeList )
                #---------------------------------------------------#
                defEleVector1 = alpacaView.BeamVectorDef(AlpacaSolvedModel,dispNodeDict) #beam
                defEleVector2 = alpacaView.ShellVectorDef(AlpacaSolvedModel,dispNodeDict) #shell
                defEleVector3 = alpacaView.BrickVectorDef(AlpacaSolvedModel,dispNodeDict) #shell
                bound = alpacaView.boundsDef(displacement, typeColor)
                if scale == None: scale = 1/bound[1]
                if self.extrudeModel == None or self.extrudeModel == False:
                    #BEAM
                    defModel1 = alpacaView.BeamDef(AlpacaSolvedModel, dispNodeDict,scale)
                    self.defModel1, self.beamColor = alpacaView.ColorBeamDef( defModel1, defEleVector1, bound, listColor, typeColor)
                    #SHELL
                    defModel2 = alpacaView.ShellDef(AlpacaSolvedModel,dispNodeDict,scale)
                    #BRICK
                    defModel3 = alpacaView.BrickDef(AlpacaSolvedModel,dispNodeDict,scale)
                else:
                    #BEAM
                    defModel1 = alpacaView.BeamDefExtrude(AlpacaSolvedModel, dispNodeDict,scale)
                    self.defModel1 = alpacaView.ColorBeamDefExtrude( defModel1, defEleVector1, bound, listColor, typeColor)
                    #SHELL
                    defModel2 = alpacaView.ShellDefExtrude(AlpacaSolvedModel,dispNodeDict,scale)
                    #BRICK
                    defModel3 = alpacaView.BrickDef(AlpacaSolvedModel,dispNodeDict,scale)
                    
                #SHELL COLOR
                self.defModel2 = alpacaView.ColorShellDef( defModel2, defEleVector2 , bound, listColor, typeColor, extrudeModel )
                #BRICK COLOR
                self.defModel3 = alpacaView.ColorBrickDef( defModel3, defEleVector3 , bound, listColor, typeColor)
                DefModel = th.list_to_tree(self.defModel1 + defModel2 + defModel3)
                bounds = ConstructDomain(bound[0], bound[1])
                return (DefModel, bounds)
            except:
                Hdf5.CloseFile(fileId)
                print("I have closed the file due to exception")
            # return outputs if you have them; here I try it for you:
        
        
    def DrawViewportWires(self,arg):
        for iMesh in self.defModel2 :
            colorWirframe = System.Drawing.Color.Black
            arg.Display.DrawMeshWires(iMesh, colorWirframe)
            
        for iMesh in self.defModel3 :
            colorWirframe = System.Drawing.Color.Black
            arg.Display.DrawMeshWires(iMesh, colorWirframe)
        if self.extrudeModel is None or self.extrudeModel is False:
            thickness =2
            for iBeam, iColor in zip(self.defModel1, self.beamColor) :
                for jBeam, jColor in zip(iBeam, iColor):
                    arg.Display.DrawCurve(jBeam, jColor, thickness)
        else:
            for iBeam in self.defModel1 :
                colorWirframe = System.Drawing.Color.Black
                arg.Display.DrawMeshWires(iBeam, colorWirframe)
# ---------- end dm ----------
nd = NodalDisplacementsAlpaca4d(AlpacaModel=ra.AlpacaSolvedModel)  # -> out, displacement, rotation; inputs History: Boolean, step: Int32
# ---------- nd: Python ----------
"""
Read displacement results
-
    Args:
        AlpacaModel:
        History: True to visualise the displacement and rotation history of the points
        step:
    Returns:
        displacement:
        rotation:
        displacement_History:
        rotation_History:
"""

ghenv.Component.Name = "Nodal Displacements (Alpaca4d)"
ghenv.Component.NickName = 'ND'
ghenv.Component.Message = "Displacements (Alpaca4d)"

import sys
import os
import System
from System.Drawing import Color


import clr
import clrtype
import Rhino.Geometry as rg
import rhinoscriptsyntax as rs
import Grasshopper as gh
import copy
import ghpythonlib.treehelpers as th



## add alpaca install directory to system path

ghcompfolder = gh.Folders.DefaultAssemblyFolder
if ghcompfolder not in sys.path:
    sys.path.append(ghcompfolder)

try:
    from Alpaca4d import alpaca4d as alpaca
except:
    msg = "Cannot import Alpaca4d. Is the Alpaca4d folder available in " + ghcompfolder + "?"
    ghenv.Component.AddRuntimeMessage(gh.Kernel.GH_RuntimeMessageLevel.Error, msg)



FolderPath = rs.DocumentPath()
os.chdir(FolderPath)

my_module_name = "Alpaca_StepReader" # replace this with something unique that doesn't collide with a real module!
my_module = sys.modules.setdefault(my_module_name, type(sys)(my_module_name))

hdfFilePath = os.path.join(ghcompfolder, "Alpaca4d\HDF5CSharp.dll")
clr.AddReferenceToFileAndPath(hdfFilePath)


from HDF5CSharp import Hdf5

try:
    Steps = my_module.Steps
except AttributeError:
    type_2d = type(System.Array.CreateInstance(float, 1, 1))

    class Steps(object):
        __metaclass__ = clrtype.ClrClass
        _clrfields = {"STEP_{}".format(i): type_2d for i in range(1000)} # it will work for model with less than 1000 steps

    my_module.Steps = Steps



checkData = True

if not AlpacaModel:
    checkData = False
    msg = "Input parameter AlpacaModel failed to collect data"
    ghenv.Component.AddRuntimeMessage(gh.Kernel.GH_RuntimeMessageLevel.Warning, msg)



History = False if History is None else History


if checkData:
    step = (int(AlpacaModel.analysis.AnalysisSteps.numIncr) - 1) if step is None else step
    numberOfPoints = len(AlpacaModel.uniquePoints) #
    
    if not History:
        try:
            fileId = Hdf5.OpenFile(AlpacaModel.recorderName, True)
            
            
            displacementResult = Hdf5.ReadObject[Steps](fileId, "/MODEL_STAGE[1]/RESULTS/ON_NODES/DISPLACEMENT/DATA")
            displacement = []
            for i in range(numberOfPoints):
                x = getattr(displacementResult, 'STEP_{}'.format(step))[i,0]
                y = getattr(displacementResult, 'STEP_{}'.format(step))[i,1]
                z = getattr(displacementResult, 'STEP_{}'.format(step))[i,2]
                displacement.append(rg.Vector3d(x,y,z))
            
            
            rotationResult = Hdf5.ReadObject[Steps](fileId, "/MODEL_STAGE[1]/RESULTS/ON_NODES/ROTATION/DATA")
            rotation = []
            for i in range(numberOfPoints):
                x = getattr(rotationResult, 'STEP_{}'.format(step))[i,0]
                y = getattr(rotationResult, 'STEP_{}'.format(step))[i,1]
                z = getattr(rotationResult, 'STEP_{}'.format(step))[i,2]
                rotation.append(rg.Vector3d(x,y,z))
                
                
            Hdf5.CloseFile(fileId)
            print("I have closed the file")
        except:
            if fileId >0:
                Hdf5.CloseFile(fileId)
                print("I have closed the file because of exception")
    
    
    
    if History:
        try:
            fileId = Hdf5.OpenFile(AlpacaModel.recorderName, True)
            
            displacementResult = Hdf5.ReadObject[Steps](fileId, "/MODEL_STAGE[1]/RESULTS/ON_NODES/DISPLACEMENT/DATA")
            displacement = []
            
            for i in range(numberOfPoints):
                dispTemp = []
                maxNumberStep = int(AlpacaModel.analysis.AnalysisSteps.numIncr)
                for n_step in range(maxNumberStep):
                    x = getattr(displacementResult, 'STEP_{}'.format(n_step))[i,0]
                    y = getattr(displacementResult, 'STEP_{}'.format(n_step))[i,1]
                    z = getattr(displacementResult, 'STEP_{}'.format(n_step))[i,2]
                    dispTemp.append(rg.Vector3d(x,y,z))
                    
                
                displacement.append(dispTemp)
    
    
    
    
            rotationResult = Hdf5.ReadObject[Steps](fileId, "/MODEL_STAGE[1]/RESULTS/ON_NODES/ROTATION/DATA")
            
            rotation = []
            
            for i in range(numberOfPoints):
                rotationTemp = []
                for n_step in range(maxNumberStep):
                    x = getattr(rotationResult, 'STEP_{}'.format(n_step))[i,0]
                    y = getattr(rotationResult, 'STEP_{}'.format(n_step))[i,1]
                    z = getattr(rotationResult, 'STEP_{}'.format(n_step))[i,2]
                    rotationTemp.append(rg.Vector3d(x,y,z))
                
                rotation.append(rotationTemp)
                
            Hdf5.CloseFile(fileId)
        except:
            Hdf5.CloseFile(fileId)
    
    
    displacement = th.list_to_tree(displacement)
    rotation = th.list_to_tree(rotation)
# ---------- end nd ----------
panel_22 = Panel(ra.log)
vlen = VectorLength(Vector=nd.displacement)
num_9 = Number(expr("Round(x*1000,1)", vlen))
sort = SortList(Keys=num_9)  # -> reverse(Keys), ValuesA
item_5 = ListItem(List=sort.Keys, Index=0, Wrap=True)
num_10 = Number(expr("Round(x*10,1)", opticrosec.MaximumDisplacement_cm))
num_11 = Number(item_5)
num_12 = Number(num_10)

panel_23 = Panel("""Karamba3d: 
Alpaca4d: """)
entwine_3 = Entwine(Branch00=num_12, Branch01=num_11, FlattenInputs=True)  # -> flatten(Result)
panel_24 = Panel(""" mm
 mm""")
concat_3 = Concatenate(FragmentA=panel_23, FragmentB=entwine_3, FragmentC=panel_24)
panel_25 = Panel(concat_3)
number_slider_6 = Slider(12, range=1..100)
lng = ListLength(List=concat_3)
series_2 = Series(Start=Slider(73, range=1..100), Step=expr("x*2", number_slider_6), Count=lng)
pt_4 = ConstructPoint(XCoordinate=Slider(42, range=1..100), YCoordinate=series_2, ZCoordinate=0)
texttoscreen = RenderTextToScreen(Text=concat_3, Location=pt_4, Size=number_slider_6, Color=RGB(0, 0, 0), Font="Inconsolata", m_scWithvp=False)

num_13 = Number([0, 0.039111, 0.020721, 0.006817, 0.002312, 0.001892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])  # disabled
num_14 = Number([0, 0.0004332755633, 0.0008665511265, 0.00129982669, 0.001733102253, 0.002166377816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])  # disabled
panel_26 = Panel("0 to 5")  # disabled
remap = RemapNumbers(Value=num_14, Source=Domain(0, 1), Target=panel_26)  # -> Mapped, Clipped; disabled
panel_27 = Panel("1000")  # disabled
pts = PathTimeSeriesAlpaca4d(time=remap.Mapped, values=num_13, factor=panel_27)  # -> out, TimeSeries, Graph; inputs time: list, values: list; disabled
# ---------- pts: Python ----------
"""
Create a Time Series Path
-
    Args:
        time:
        values:
        factor:
    Returns:
        TimeSeries:
        Graph:
"""

ghenv.Component.Name = "Path Time Series (Alpaca4d)"
ghenv.Component.NickName = 'PTS'
ghenv.Component.Message = "Path Time Series (Alpaca4d)"


import sys
import Rhino.Geometry as rg
import Grasshopper as gh
import copy


## add alpaca install directory to system path

ghcompfolder = gh.Folders.DefaultAssemblyFolder
if ghcompfolder not in sys.path:
    sys.path.append(ghcompfolder)

try:
    from Alpaca4d import alpaca4d as alpaca
except:
    msg = "Cannot import Alpaca4d. Is the Alpaca4d folder available in " + ghcompfolder + "?"
    ghenv.Component.AddRuntimeMessage(gh.Kernel.GH_RuntimeMessageLevel.Error, msg)


checkData = True

if not time:
    checkData = False
    msg = "Input parameter time failed to collect data"
    ghenv.Component.AddRuntimeMessage(gh.Kernel.GH_RuntimeMessageLevel.Warning, msg)

if not values:
    checkData = False
    msg = "Input parameter values failed to collect data"
    ghenv.Component.AddRuntimeMessage(gh.Kernel.GH_RuntimeMessageLevel.Warning, msg)

if not factor:
    factor = 1


if checkData:
    TimeSeries = alpaca.TimeSeriesPath(values, time, factor)
    Graph = [value * factor for value in values]
# ---------- end pts ----------
panel_28 = Panel(pts.Graph)  # disabled
vec_5 = Vector(vec_3.Vector)  # disabled
pt_5 = Point(flatten(cullpt_2.Points))  # disabled
pl_2 = PointLoadAlpaca4d(Pos=pt_5, Force=vec_5, TimeSeries=pts.TimeSeries)  # -> out, Load; inputs Pos: Point3d, Force: Vector3d, Moment: Vector3d; disabled; same code as pl
panel_29 = Panel("3000")  # disabled
am_2 = AssembleModelAlpaca4d(Load=pl_2.Load)  # -> out, AlpacaModel, Mass; inputs Element: list, Support: list, Load: list, Constraint: list; disabled; same code as am
as_3 = AnalysesStepsAlpaca4d(numIncr=panel_29, dt=panel_17)  # -> AnalysisSteps; inputs numIncr: Int32; disabled; same code as as
panel_30 = Panel("Transient")  # disabled
as_4 = AnalysisSettingsAlpaca4d(AnalysisType=panel_30, AnalysisSteps=as_3)  # -> Settings; disabled; same code as as_2
ra_2 = RunAnalysisAlpaca4d(AlpacaModel=am_2.AlpacaModel, Settings=as_4)  # -> log, AlpacaSolvedModel; disabled; same code as ra
clr_2 = ColorsAlpaca4d(gradIndex=11)  # -> reverse(colors); inputs gradIndex: Int32; disabled; same code as clr
number_slider_7 = Slider(74, range=0..100)  # disabled
toggle = BooleanToggle(True)  # disabled
toggle_2 = BooleanToggle(True)  # disabled
panel_31 = Panel(ra_2.log)  # disabled
panel_32 = Panel("2")  # disabled
toggle_3 = BooleanToggle(True)  # disabled
vm_2 = ViewModelAlpaca4d(AlpacaModel=ra_2.AlpacaSolvedModel, nodeTag=toggle_3)  # inputs type: Boolean, nodeTag: Boolean, eleTag: Boolean, localAxis: Boolean, support: Boolean, load: Boolean; disabled; same code as vm

y_value_time_series = Data(pts.Graph)  # disabled
lng_2 = ListLength(List=y_value_time_series)  # disabled
series_3 = Series(Start=0, Step=1, Count=lng_2)  # disabled
pt_6 = ConstructPoint(XCoordinate=series_3, YCoordinate=y_value_time_series, ZCoordinate=0)  # disabled
bbox = BoundingBox(Content=pt_6, Plane=PlaneXY(0, 0, 0), UnionBox=True)  # -> Box, Box_2; disabled
dim = Dimensions(Surface=bbox.Box)  # -> UDimension, VDimension; disabled
division = Division(A=panel_16, B=dim.VDimension)  # disabled
division_2 = Division(A=panel_16, B=dim.UDimension)  # disabled
graph = QuickGraph(pts.Graph, SortOrder=0)  # disabled
scale_nu = ScaleNU(Geometry=pt_6, Plane=PlaneXY(0, 0, 0), ScaleX=division_2, ScaleY=division, ScaleZ=1)  # -> Geometry, Transform; disabled
scale_nu_2 = ScaleNU(Geometry=scale_nu.Geometry, Plane=PlaneXY(0, 0, 0), ScaleX=number_slider_2, ScaleY=number_slider_3, ScaleZ=1)  # -> Geometry, Transform; disabled
pline_5 = PolyLine(Vertices=scale_nu_2.Geometry, Closed=False)  # disabled

# ----
# Frame
bbox_2 = BoundingBox(Content=pline_5, Plane=PlaneXY(0, 0, 0), UnionBox=True)  # -> Box, Box_2; disabled
area = Area(Geometry=bbox_2.Box)  # -> Area, Centroid; disabled
panel_33 = Panel("1.05")  # disabled
scale = Scale(Geometry=bbox_2.Box, Center=area.Centroid, Factor=panel_33)  # -> Geometry, Transform; disabled
debrep = DeconstructBrep(Brep=scale.Geometry)  # -> Faces, Edges, Vertices; disabled
crv = Curve(debrep.Edges)  # disabled
toggle_4 = BooleanToggle(True)  # disabled
swatch_3 = ColourSwatch(SwatchColor=RGB(0, 0, 0))  # disabled
panel_34 = Panel("1")  # disabled
crvtoscreen = RenderCurveToScreen(
    Curve=crv,
    Location=pt_2,
    ScaleFactor=1,
    Color=swatch_3,
    Thickness=panel_34,
    Depth=0.95,
    Fixed=toggle_4,
    m_scWithvp=False)  # disabled

lng_3 = ListLength(List=remap.Mapped)  # disabled
division_3 = Division(A=panel_19, B=lng_3)  # disabled
nd_2 = NodalDisplacementsAlpaca4d(AlpacaModel=ra_2.AlpacaSolvedModel, History=toggle, step=number_slider_7)  # -> out, displacement, rotation; inputs History: Boolean, step: Int32; disabled
# ---------- nd_2: Python ----------
"""
Read displacement results
-
    Args:
        AlpacaModel:
        History: True to visualise the displacement and rotation history of the points
        step:
    Returns:
        displacement:
        rotation:
        displacement_History:
        rotation_History:
"""

ghenv.Component.Name = "Nodal Displacements (Alpaca4d)"
ghenv.Component.NickName = 'ND'
ghenv.Component.Message = "Displacements (Alpaca4d)"

import sys
import os
import System
from System.Drawing import Color


import clr
import clrtype
import Rhino.Geometry as rg
import rhinoscriptsyntax as rs
import Grasshopper as gh
import copy
import ghpythonlib.treehelpers as th



## add alpaca install directory to system path

ghcompfolder = gh.Folders.DefaultAssemblyFolder
if ghcompfolder not in sys.path:
    sys.path.append(ghcompfolder)

try:
    from Alpaca4d import alpaca4d as alpaca
except:
    msg = "Cannot import Alpaca4d. Is the Alpaca4d folder available in " + ghcompfolder + "?"
    ghenv.Component.AddRuntimeMessage(gh.Kernel.GH_RuntimeMessageLevel.Error, msg)



FolderPath = rs.DocumentPath()
os.chdir(FolderPath)

my_module_name = "Alpaca_StepReader" # replace this with something unique that doesn't collide with a real module!
my_module = sys.modules.setdefault(my_module_name, type(sys)(my_module_name))

hdfFilePath = os.path.join(ghcompfolder, "Alpaca4d\HDF5CSharp.dll")
clr.AddReferenceToFileAndPath(hdfFilePath)


from HDF5CSharp import Hdf5

try:
    Steps = my_module.Steps
except AttributeError:
    type_2d = type(System.Array.CreateInstance(float, 1, 1))

    class Steps(object):
        __metaclass__ = clrtype.ClrClass
        _clrfields = {"STEP_{}".format(i): type_2d for i in range(5000)} # it will work for model with less than 1000 steps

    my_module.Steps = Steps



checkData = True

if not AlpacaModel:
    checkData = False
    msg = "Input parameter AlpacaModel failed to collect data"
    ghenv.Component.AddRuntimeMessage(gh.Kernel.GH_RuntimeMessageLevel.Warning, msg)



History = False if History is None else History


if checkData:
    step = (int(AlpacaModel.analysis.AnalysisSteps.numIncr) - 1) if step is None else step
    numberOfPoints = len(AlpacaModel.uniquePoints) #
    
    if not History:
        try:
            fileId = Hdf5.OpenFile(AlpacaModel.recorderName, True)
            
            
            displacementResult = Hdf5.ReadObject[Steps](fileId, "/MODEL_STAGE[1]/RESULTS/ON_NODES/DISPLACEMENT/DATA")
            displacement = []
            for i in range(numberOfPoints):
                x = getattr(displacementResult, 'STEP_{}'.format(step))[i,0]
                y = getattr(displacementResult, 'STEP_{}'.format(step))[i,1]
                z = getattr(displacementResult, 'STEP_{}'.format(step))[i,2]
                displacement.append(rg.Vector3d(x,y,z))
            
            
            rotationResult = Hdf5.ReadObject[Steps](fileId, "/MODEL_STAGE[1]/RESULTS/ON_NODES/ROTATION/DATA")
            rotation = []
            for i in range(numberOfPoints):
                x = getattr(rotationResult, 'STEP_{}'.format(step))[i,0]
                y = getattr(rotationResult, 'STEP_{}'.format(step))[i,1]
                z = getattr(rotationResult, 'STEP_{}'.format(step))[i,2]
                rotation.append(rg.Vector3d(x,y,z))
                
                
            Hdf5.CloseFile(fileId)
            print("I have closed the file")
        except:
            if fileId >0:
                Hdf5.CloseFile(fileId)
                print("I have closed the file because of exception")
    
    
    
    if History:
        try:
            fileId = Hdf5.OpenFile(AlpacaModel.recorderName, True)
            
            displacementResult = Hdf5.ReadObject[Steps](fileId, "/MODEL_STAGE[1]/RESULTS/ON_NODES/DISPLACEMENT/DATA")
            displacement = []
            
            for i in range(numberOfPoints):
                dispTemp = []
                maxNumberStep = int(AlpacaModel.analysis.AnalysisSteps.numIncr)
                for n_step in range(maxNumberStep):
                    x = getattr(displacementResult, 'STEP_{}'.format(n_step))[i,0]
                    y = getattr(displacementResult, 'STEP_{}'.format(n_step))[i,1]
                    z = getattr(displacementResult, 'STEP_{}'.format(n_step))[i,2]
                    dispTemp.append(rg.Vector3d(x,y,z))
                    
                
                displacement.append(dispTemp)
    
    
    
    
            rotationResult = Hdf5.ReadObject[Steps](fileId, "/MODEL_STAGE[1]/RESULTS/ON_NODES/ROTATION/DATA")
            
            rotation = []
            
            for i in range(numberOfPoints):
                rotationTemp = []
                for n_step in range(maxNumberStep):
                    x = getattr(rotationResult, 'STEP_{}'.format(n_step))[i,0]
                    y = getattr(rotationResult, 'STEP_{}'.format(n_step))[i,1]
                    z = getattr(rotationResult, 'STEP_{}'.format(n_step))[i,2]
                    rotationTemp.append(rg.Vector3d(x,y,z))
                
                rotation.append(rotationTemp)
                
            Hdf5.CloseFile(fileId)
        except:
            Hdf5.CloseFile(fileId)
    
    
    displacement = th.list_to_tree(displacement)
    rotation = th.list_to_tree(rotation)
# ---------- end nd_2 ----------
dm_2 = DeformedModelAlpaca4d(AlpacaSolvedModel=ra_2.AlpacaSolvedModel, step=number_slider_5, scale=panel_32, extrudeModel=toggle_2, listColor=clr_2)  # -> DefModel, bounds; inputs step: Int32, extrudeModel: Boolean, typeColor: Int32, listColor: list of Color; disabled
# ---------- dm_2: Python ----------
"""View Deformed model
    Args:
        AlpacaSolvedModel: Output of Analyses solver
        step:
        scale: Multiplication factor for displacement
        extrudeModel:  
True : view extruded model
else : view stick model
        typeColor:  View relative color of the traslation
<=0 : view traslation X 
1 : view traslation Y
2 : view traslation Z
>= 3 : view resulting displacement.
        listColor : one list of color 

    Output:
       DefModel: view deformed model
       bounds: max end min of displacement of the structure 
"""

ghenv.Component.Name = "Deformed Model (Alpaca4d)"
ghenv.Component.NickName = 'DM'
ghenv.Component.Message = "Deformed Model (Alpaca4d)"

from ghpythonlib.componentbase import executingcomponent as component
import System
import rhinoscriptsyntax as rs

import sys
import os
import clr
import clrtype
import Rhino.Geometry as rg
import Rhino as rc
import math as mt
import Grasshopper as gh
import ghpythonlib.treehelpers as th
from ghpythonlib.components import ConstructDomain

ghcompfolder = gh.Folders.DefaultAssemblyFolder
if ghcompfolder not in sys.path:
    sys.path.append(ghcompfolder)
try:
    from Alpaca4d import alpaca4dView as alpacaView
except:
    msg = "Cannot import Alpaca4d. Is the Alpaca4d folder available in " + ghcompfolder + "?"
    ghenv.Component.AddRuntimeMessage(gh.Kernel.GH_RuntimeMessageLevel.Error, msg)
    
FolderPath = rs.DocumentPath()
os.chdir(FolderPath)

ghcompfolder = gh.Folders.DefaultAssemblyFolder
my_module_name = "Alpaca_StepReader"
my_module = sys.modules.setdefault(my_module_name, type(sys)(my_module_name))


try:
    Steps_dm = my_module.Steps_dm
    Modes = my_module.Modes
except AttributeError:
    type_2d = type(System.Array.CreateInstance(float, 1, 1))

    class Steps_dm(object):
        __metaclass__ = clrtype.ClrClass
        _clrfields = {"STEP_{}".format(i): type_2d for i in range(5000)} # it will work for model with less than 1000 steps

    class Modes(object):
        __metaclass__ = clrtype.ClrClass
        _clrfields = {"MODE_{}".format(i): type_2d for i in range(5000)} # it will work for model with less than 1000 steps

    my_module.Steps_dm = Steps_dm
    my_module.Modes = Modes


hdfFilePath = os.path.join(ghcompfolder, "Alpaca4d\HDF5CSharp.dll")
clr.AddReferenceToFileAndPath(hdfFilePath)

from HDF5CSharp import Hdf5

class MyComponent(component):
    
    def RunScript(self, AlpacaSolvedModel, step = None, scale = None , extrudeModel = None, typeColor = None, listColor = [] ):
        import sys
        
        self.extrudeModel = extrudeModel
        
        self.defModel1 = []
        self.defModel2 = []
        self.defModel3 = []
        
        self.beamColor = []
        

        if step == None:
            step = 0
        if extrudeModel == None:
            extrudeModel = False
        if typeColor == None:
            typeColor = 3
        
        if not listColor: listColor = [ System.Drawing.Color.DarkViolet, 
                                        System.Drawing.Color.BlueViolet, 
                                        System.Drawing.Color.RoyalBlue, 
                                        System.Drawing.Color.CornflowerBlue,
                                        System.Drawing.Color.LightSkyBlue, 
                                        System.Drawing.Color.LightBlue,
                                        System.Drawing.Color.CadetBlue,
                                        System.Drawing.Color.LightGreen,
                                        System.Drawing.Color.GreenYellow,
                                        System.Drawing.Color.Yellow,
                                        System.Drawing.Color.Orange,
                                        System.Drawing.Color.Red,
                                        System.Drawing.Color.DarkRed]
            
        checkData = True
        
        if not AlpacaSolvedModel:
            checkData = False
            msg = "Input parameter AlpacaSolvedModel failed to collect data"
            ghenv.Component.AddRuntimeMessage(gh.Kernel.GH_RuntimeMessageLevel.Warning, msg)
        else:
            try:
                fileId = Hdf5.OpenFile(AlpacaSolvedModel.recorderName, True)
                print( AlpacaSolvedModel.recorderName)
                numberOfPoints = len(AlpacaSolvedModel.uniquePoints) #
                
                displacement = []
                rotation = []
                dispNodeList = []
                
                if AlpacaSolvedModel.isModal == True:
                    print( AlpacaSolvedModel.isModal == True )
                    outputData = "MODEL_STAGE[1]/RESULTS/ON_NODES/MODES_OF_VIBRATION(U)/DATA/STEP_0"
                    print( outputData )
                    displacementResult = Hdf5.ReadObject[Modes](fileId, outputData)
                    for i in range(numberOfPoints):
                        tag = i + 1
                        vx = getattr(displacementResult, 'MODE_{}'.format(step))[i,0]
                        vy = getattr(displacementResult, 'MODE_{}'.format(step))[i,1]
                        vz = getattr(displacementResult, 'MODE_{}'.format(step))[i,2]
                        trasl = rg.Vector3d(vx,vy,vz)
                        displacement.append(trasl)
                        dispNodeList.append( [tag, trasl] )
                        
                    Hdf5.CloseFile(fileId)
                    print("I have closed the file")
                else: 
                    outputData = "/MODEL_STAGE[1]/RESULTS/ON_NODES/DISPLACEMENT/DATA"
                    print( outputData )
                    displacementResult = Hdf5.ReadObject[Steps_dm](fileId, outputData)
                    for i in range(numberOfPoints):
                        tag = i + 1
                        vx = getattr(displacementResult, 'STEP_{}'.format(step))[i,0]
                        vy = getattr(displacementResult, 'STEP_{}'.format(step))[i,1]
                        vz = getattr(displacementResult, 'STEP_{}'.format(step))[i,2]
                        trasl = rg.Vector3d(vx,vy,vz)
                        displacement.append(trasl)
                        dispNodeList.append( [tag, trasl] )
                        
                    Hdf5.CloseFile(fileId)
                    print("I have closed the file")
            
                dispNodeDict = dict( dispNodeList )
                #---------------------------------------------------#
                defEleVector1 = alpacaView.BeamVectorDef(AlpacaSolvedModel,dispNodeDict) #beam
                defEleVector2 = alpacaView.ShellVectorDef(AlpacaSolvedModel,dispNodeDict) #shell
                defEleVector3 = alpacaView.BrickVectorDef(AlpacaSolvedModel,dispNodeDict) #shell
                bound = alpacaView.boundsDef(displacement, typeColor)
                if scale == None: scale = 1/bound[1]
                if self.extrudeModel == None or self.extrudeModel == False:
                    #BEAM
                    defModel1 = alpacaView.BeamDef(AlpacaSolvedModel, dispNodeDict,scale)
                    self.defModel1, self.beamColor = alpacaView.ColorBeamDef( defModel1, defEleVector1, bound, listColor, typeColor)
                    #SHELL
                    defModel2 = alpacaView.ShellDef(AlpacaSolvedModel,dispNodeDict,scale)
                    #BRICK
                    defModel3 = alpacaView.BrickDef(AlpacaSolvedModel,dispNodeDict,scale)
                else:
                    #BEAM
                    defModel1 = alpacaView.BeamDefExtrude(AlpacaSolvedModel, dispNodeDict,scale)
                    self.defModel1 = alpacaView.ColorBeamDefExtrude( defModel1, defEleVector1, bound, listColor, typeColor)
                    #SHELL
                    defModel2 = alpacaView.ShellDefExtrude(AlpacaSolvedModel,dispNodeDict,scale)
                    #BRICK
                    defModel3 = alpacaView.BrickDef(AlpacaSolvedModel,dispNodeDict,scale)
                    
                #SHELL COLOR
                self.defModel2 = alpacaView.ColorShellDef( defModel2, defEleVector2 , bound, listColor, typeColor, extrudeModel )
                #BRICK COLOR
                self.defModel3 = alpacaView.ColorBrickDef( defModel3, defEleVector3 , bound, listColor, typeColor)
                DefModel = th.list_to_tree(self.defModel1 + defModel2 + defModel3)
                bounds = ConstructDomain(bound[0], bound[1])
                return (DefModel, bounds)
            except:
                Hdf5.CloseFile(fileId)
                print("I have closed the file due to exception")
            # return outputs if you have them; here I try it for you:
        
        
    def DrawViewportWires(self,arg):
        for iMesh in self.defModel2 :
            colorWirframe = System.Drawing.Color.Black
            arg.Display.DrawMeshWires(iMesh, colorWirframe)
            
        for iMesh in self.defModel3 :
            colorWirframe = System.Drawing.Color.Black
            arg.Display.DrawMeshWires(iMesh, colorWirframe)
        if self.extrudeModel is None or self.extrudeModel is False:
            thickness =2
            for iBeam, iColor in zip(self.defModel1, self.beamColor) :
                for jBeam, jColor in zip(iBeam, iColor):
                    arg.Display.DrawCurve(jBeam, jColor, thickness)
        else:
            for iBeam in self.defModel1 :
                colorWirframe = System.Drawing.Color.Black
                arg.Display.DrawMeshWires(iBeam, colorWirframe)
# ---------- end dm_2 ----------

# ----
# Curve Path
toggle_5 = BooleanToggle(True)  # disabled
swatch_4 = ColourSwatch(SwatchColor=RGB(0, 0, 0))  # disabled
crv_2 = Curve(pline_5)  # disabled
crvtoscreen_2 = RenderCurveToScreen(Curve=crv_2, Location=pt_2, ScaleFactor=1, Color=swatch_4, Thickness=1, Depth=0.95, Fixed=toggle_5, m_scWithvp=False)  # disabled

devec = DeconstructVector(Vector=nd_2.displacement)  # -> XComponent, YComponent, ZComponent; disabled

panel_35 = Panel(nd_2.displacement)  # disabled
vlen_2 = VectorLength(Vector=nd_2.displacement)  # disabled
panel_36 = Panel(dm_2.bounds)  # disabled
graph_2 = QuickGraph(devec.XComponent, SortOrder=0)  # disabled

geo_2 = Geometry(dm_2.DefModel)  # disabled
explode_7 = MeshExplode(Mesh=geo_2, Interpolate=False)  # disabled
bnd = Bounds(Numbers=flatten(vlen_2))  # disabled
area_2 = MeshArea(Mesh=explode_7)  # -> Area, Centroid; disabled
equals = Equality(FirstNumber=area_2.Area, SecondNumber=0)  # -> Equality, Inequality; disabled
cull = CullPattern(List=explode_7, CullPattern=invert(equals.Equality))  # disabled
mjoin = MeshJoin(Meshes=flatten(cull))  # disabled
mshadow = MeshShadow(Mesh=mjoin, Light=vec_2.Vector, Plane=PlaneXY(0, 0, 0))  # disabled
boundary = BoundarySurfaces(Edges=mshadow)  # disabled
preview = CustomPreview(Geometry=boundary, Material=swatch_2)  # disabled

# ----
# Text
number_slider_8 = Slider(15, range=1..100)  # disabled
panel_37 = Panel("1.5")  # disabled
multiplication_2 = Multiplication(A=number_slider_8, B=panel_37)  # disabled
neg_2 = Negative(Value=multiplication_2)  # disabled
txt = Text(number_slider_5)  # disabled
Y_2 = UnitY(Factor=neg_2)  # disabled
item_6 = ListItem(List=debrep.Vertices, Index=0, Wrap=True)  # disabled
move_2 = Move(Geometry=item_6, Motion=Y_2)  # -> Geometry, Transform; disabled
panel_38 = Panel("t = ")  # disabled
xy = XYPlane(Origin=move_2.Geometry)  # disabled
toggle_6 = BooleanToggle(True)  # disabled
swatch_5 = ColourSwatch(SwatchColor=RGB(0, 0, 0))  # disabled

multiplication_3 = Multiplication(A=txt, B=panel_17)  # disabled
fsim = FindSimilarMember(Data=multiplication_3, Set=remap.Mapped)  # -> Hit, Index; disabled
num_15 = Number(expr("Round(x,2)", multiplication_3))  # disabled
item_7 = ListItem(List=scale_nu_2.Geometry, Index=fsim.Index, Wrap=True)  # disabled

concat_4 = Concatenate(FragmentA=panel_38, FragmentB=num_15, FragmentC=panel_20)  # disabled
python_3 = GhPythonScript(plane=xy, textHeight=number_slider_8, text=concat_4)  # -> a; inputs plane: Plane, textHeight: Int32; disabled
# ---------- python_3: Python ----------
import Rhino.Geometry as rg

font = "Inconsolata"
textStyle = 0
closeLoops = True
plane = rg.Plane.WorldXY if plane is None else plane
smallCapsScale = 10
tolerance = 0.01

a = rg.Curve.CreateTextOutlines(text, font, textHeight, textStyle, closeLoops, plane, smallCapsScale, tolerance)
# ---------- end python_3 ----------
crvtoscreen_3 = RenderCurveToScreen(Curve=python_3, Location=pt_2, ScaleFactor=1, Color=swatch_5, Thickness=1, Depth=0.95, Fixed=toggle_6, m_scWithvp=False)  # disabled

# ----
# Point
panel_39 = Panel("3")  # disabled
swatch_6 = ColourSwatch(SwatchColor=RGB(255, 0, 0))  # disabled
pt_7 = Point(item_7)  # disabled
pttoscreen = RenderPointToScreen(Point=pt_7, Location=pt_2, ScaleFactor=1, Color=swatch_6, Radius=panel_39, Depth=0.95, Fixed=True, m_scWithvp=False)  # disabled
