# Grasshopper definition SectionComponent2.gh (Grasshopper 1.0.7)

# ---- group: Element
data = Data(0)
data_2 = Data(0)

# ---- group: Load
data_3 = Data(0)
data_4 = Data(0)

# ---- group: Cross-Section
data_5 = Data(0)
data_6 = Data(0)

# ---- group: Support
data_7 = Data(0)
data_8 = Data(0)

# ---- group: Constraint
data_9 = Data(0)
data_10 = Data(0)

# ---- group: Material
data_11 = Data(0)
data_12 = Data(0)

# ----
number_slider = Slider(12, range=0..100)
number_slider_2 = Slider(3, range=0..10)

# ---- group: sezione rettangolare
number_slider_3 = Slider(0.03, range=0..0.1)
division = Division(A=Slider(0.6, range=0..1), B=2)
division_2 = Division(A=Slider(0.3, range=0..1), B=2)
neg = Negative(Value=division)
neg_2 = Negative(Value=division_2)
neg_3 = Negative(Value=number_slider_3)
dom = ConstructDomain(DomainStart=neg, DomainEnd=division)
# Section shape
dom_2 = ConstructDomain(DomainStart=neg_2, DomainEnd=division_2)
rectangle = Rectangle(Plane=PlaneXY(0, 0, 0), XSize=dom_2, YSize=dom, Radius=0)  # -> Rectangle, Length
offset = OffsetCurve(Curve=rectangle.Rectangle, Distance=neg_3, Plane=PlaneXY(0, 0, 0), Corners=1)
explode = Explode(Curve=offset, Recursive=True)  # -> Segments, Vertices
item = ListItem(List=explode.Segments, Index=0, Wrap=True)  # -> Item, Item1, Item2, Item3
crv = Curve(item.Item2)
crv_2 = Curve(item.Item)

# ----
number_slider_4 = Slider(4, range=0..10)
division_3 = Division(A=number_slider, B=Slider(1000, range=0..1000))
minmax = UEMMinMaxAlpaca4d(minStrain=number_slider_2, maxStrain=number_slider_2)  # -> out, MinMax
# ---------- minmax: Python ----------
"""
Create a uniaxial Elastic Material Concreate01
-
    Args:
        minStrain: minimum value of strain. optional default = -1.0e16
        maxStrain: max value of strain. optional default = 1.0e16.
    Returns:
        MinMax:
"""

__author__ = "Domenico Gaudioso"
__contact__ = "DomenicoGaudioso@outlook.it"
__version__ = "2021.09.17"

ghenv.Component.Name = "UEM MinMax (Alpaca4d)"
ghenv.Component.NickName = 'MinMax'
ghenv.Component.Message = "UEM MinMax (Alpaca4d)"

import sys
import Rhino.Geometry as rg
import Grasshopper as gh
import copy


## add alpaca install directory to system path

ghcompfolder = gh.Folders.DefaultAssemblyFolder
if ghcompfolder not in sys.path:
    sys.path.append(ghcompfolder)

try:
    from Alpaca4d import alpaca4d as alpaca
except:
    msg = "Cannot import Alpaca4d. Is the Alpaca4d folder available in " + ghcompfolder + "?"
    ghenv.Component.AddRuntimeMessage(gh.Kernel.GH_RuntimeMessageLevel.Error, msg)


checkData = True

if not minStrain:
    checkData = False
    msg = "Input parameter minStrain failed to collect data"
    ghenv.Component.AddRuntimeMessage(gh.Kernel.GH_RuntimeMessageLevel.Warning, msg)

if not maxStrain:
    checkData = False
    msg = "Input parameter maxStrain failed to collect data"
    ghenv.Component.AddRuntimeMessage(gh.Kernel.GH_RuntimeMessageLevel.Warning, msg)


if checkData:
    MinMax = alpaca.uniAxialMaterialMinMax(minStrain, minStrain)
# ---------- end minmax ----------
addition = Addition(A=number_slider_3, B=division_3)
panel = Panel(minmax.MinMax)

uems02 = UniaxialElasticMaterialSteel02Alpaca4d(MinMax=minmax.MinMax, fy="1", E0="1", b="1", R0=10, cR1=0.925, cR2=0.15, a1=1, a2=1, a3=1, a4=1, sigmaInit=0)  # -> out, uniAxialMaterial
# ---------- uems02: Python ----------
"""
Create a uniaxial Elastic Material Concreate01
-
    Args:
        fy: yield strength
        Eo: initial elastic tangent
        b: strain-hardening ratio (ratio between post-yield tangent and initial elastic tangent)
    Returns:
        uniAxialMaterial:
"""

__author__ = "Domenico Gaudioso"
__contact__ = "DomenicoGaudioso@outlook.it"
__version__ = "2021.09.17"

ghenv.Component.Name = "uniaxial Elastic Material Steel02 (Alpaca4d)"
ghenv.Component.NickName = 'UEMS02'
ghenv.Component.Message = "uniaxial Steel02 (Alpaca4d)"

import sys
import Rhino.Geometry as rg
import Grasshopper as gh
import copy


## add alpaca install directory to system path

ghcompfolder = gh.Folders.DefaultAssemblyFolder
if ghcompfolder not in sys.path:
    sys.path.append(ghcompfolder)


   
   
try:
    from Alpaca4d import alpaca4d as alpaca
except:
    msg = "Cannot import Alpaca4d. Is the Alpaca4d folder available in " + ghcompfolder + "?"
    ghenv.Component.AddRuntimeMessage(gh.Kernel.GH_RuntimeMessageLevel.Error, msg)


checkData = True

if not fy:
    checkData = False
    msg = "Input parameter fy failed to collect data"
    ghenv.Component.AddRuntimeMessage(gh.Kernel.GH_RuntimeMessageLevel.Warning, msg)

if not E0:
    checkData = False
    msg = "Input parameter E0 failed to collect data"
    ghenv.Component.AddRuntimeMessage(gh.Kernel.GH_RuntimeMessageLevel.Warning, msg)
    
"""
if not b:
    checkData = False
    msg = "Input parameter b failed to collect data"
    ghenv.Component.AddRuntimeMessage(gh.Kernel.GH_RuntimeMessageLevel.Warning, msg)
"""


if checkData:
    uniAxialMaterial = alpaca.uniAxialMaterialSteel02(name, MinMax, fy, E0, b, R0, cR1, cR2, a1, a2, a3, a4, sigmaInit)
# ---------- end uems02 ----------
uemc01 = UniaxialElasticMaterialConcreate01Alpaca4d(fc=number_slider_4, fcu=number_slider_4, ec0=number_slider_4, ecu=number_slider_4)  # -> out, uniAxialMaterial
# ---------- uemc01: Python ----------
"""
Create a uniaxial Elastic Material Concreate01
-
    Args:
        fc:
        fcu:
        ec0:
        ecu:
    Returns:
        uniAxialMaterial:
"""

__author__ = "Domenico Gaudioso"
__contact__ = "DomenicoGaudioso@outlook.it"
__version__ = "2021.09.17"

ghenv.Component.Name = "uniaxial Elastic Material Concreate01 (Alpaca4d)"
ghenv.Component.NickName = 'UEMC01'
ghenv.Component.Message = "uniaxial Concreate01 (Alpaca4d)"

import sys
import Rhino.Geometry as rg
import Grasshopper as gh
import copy


## add alpaca install directory to system path

ghcompfolder = gh.Folders.DefaultAssemblyFolder
if ghcompfolder not in sys.path:
    sys.path.append(ghcompfolder)

try:
    from Alpaca4d import alpaca4d as alpaca
except:
    msg = "Cannot import Alpaca4d. Is the Alpaca4d folder available in " + ghcompfolder + "?"
    ghenv.Component.AddRuntimeMessage(gh.Kernel.GH_RuntimeMessageLevel.Error, msg)


checkData = True

if not fc:
    checkData = False
    msg = "Input parameter fc failed to collect data"
    ghenv.Component.AddRuntimeMessage(gh.Kernel.GH_RuntimeMessageLevel.Warning, msg)

if fcu == 'None':
    checkData = False
    msg = "Input parameter fcu failed to collect data"
    ghenv.Component.AddRuntimeMessage(gh.Kernel.GH_RuntimeMessageLevel.Warning, msg)

if not ec0:
    checkData = False
    msg = "Input parameter ec0 failed to collect data"
    ghenv.Component.AddRuntimeMessage(gh.Kernel.GH_RuntimeMessageLevel.Warning, msg)

if not ecu:
    checkData = False
    msg = "Input parameter ecu failed to collect data"
    ghenv.Component.AddRuntimeMessage(gh.Kernel.GH_RuntimeMessageLevel.Warning, msg)

if checkData:
    uniAxialMaterial = alpaca.uniAxialMaterialConcreate01(name, MinMax, fc, ec0, fcu, ecu)

print(uniAxialMaterial.ToString())
# ---------- end uemc01 ----------
uemc02 = UniaxialElasticMaterialConcreate02Alpaca4d(MinMax=minmax.MinMax, fpc="1", fpcu="1", epc0="1", epcu="1", lambd="1", ft="1", Ets="1")  # -> out, uniAxialMaterial
# ---------- uemc02: Python ----------
"""
Create a uniaxial Elastic Material Concreate01
-
    Args:
        fpc: concrete compressive strength at 28 days (compression is negative)*
        fpcu: concrete crushing strength *
        epc0: concrete strain at maximum strength*
        epcu: concrete strain at crushing strength*
        lambd: ratio between unloading slope at $epscu and initial slope
        ft:	tensile strength
        Ets: tension softening stiffness (absolute value) (slope of the linear tension softening branch)

    Returns:
        uniAxialMaterial:
"""

__author__ = "Domenico Gaudioso"
__contact__ = "DomenicoGaudioso@outlook.it"
__version__ = "2021.09.17"


ghenv.Component.Name = "uniaxial Elastic Material Concreate02 (Alpaca4d)"
ghenv.Component.NickName = 'UEMC02'
ghenv.Component.Message = "uniaxial Concreate02 (Alpaca4d)"

import sys
import Rhino.Geometry as rg
import Grasshopper as gh
import copy


## add alpaca install directory to system path

ghcompfolder = gh.Folders.DefaultAssemblyFolder
if ghcompfolder not in sys.path:
    sys.path.append(ghcompfolder)

try:
    from Alpaca4d import alpaca4d as alpaca
except:
    msg = "Cannot import Alpaca4d. Is the Alpaca4d folder available in " + ghcompfolder + "?"
    ghenv.Component.AddRuntimeMessage(gh.Kernel.GH_RuntimeMessageLevel.Error, msg)


checkData = True

if not fpc:
    checkData = False
    msg = "Input parameter fpc failed to collect data"
    ghenv.Component.AddRuntimeMessage(gh.Kernel.GH_RuntimeMessageLevel.Warning, msg)

if fpcu == 'None':
    checkData = False
    msg = "Input parameter fpcu failed to collect data"
    ghenv.Component.AddRuntimeMessage(gh.Kernel.GH_RuntimeMessageLevel.Warning, msg)

if not epc0:
    checkData = False
    msg = "Input parameter epc0 failed to collect data"
    ghenv.Component.AddRuntimeMessage(gh.Kernel.GH_RuntimeMessageLevel.Warning, msg)

if not epcu:
    checkData = False
    msg = "Input parameter epcu failed to collect data"
    ghenv.Component.AddRuntimeMessage(gh.Kernel.GH_RuntimeMessageLevel.Warning, msg)

if not lambd:
    checkData = False
    msg = "Input parameter lambd failed to collect data"
    ghenv.Component.AddRuntimeMessage(gh.Kernel.GH_RuntimeMessageLevel.Warning, msg)

if not ft:
    checkData = False
    msg = "Input parameter ft failed to collect data"
    ghenv.Component.AddRuntimeMessage(gh.Kernel.GH_RuntimeMessageLevel.Warning, msg)

if not Ets:
    checkData = False
    msg = "Input parameter Ets failed to collect data"
    ghenv.Component.AddRuntimeMessage(gh.Kernel.GH_RuntimeMessageLevel.Warning, msg)
    

if checkData:
    uniAxialMaterial = alpaca.uniAxialMaterialConcreate02(name, MinMax, fpc, epc0, fpcu, epcu, lambd, ft, Ets)
# ---------- end uemc02 ----------
uemrs = UniaxialElasticMaterialReinforcingSteelAlpaca4d(MinMax=minmax.MinMax, fy="1", fu="1", Es="1", Esh="1", esh="1", eult="1")  # -> out, uniAxialMaterial
# ---------- uemrs: Python ----------
"""
Create a uniaxial Elastic Material Reinforcing Steel
-
    Args:
        fy: Yield stress in tension
        fu: Ultimate stress in tension
        Es: Initial elastic tangent
        Esh: Tangent at initial strain hardening
        esh: Strain corresponding to initial strain hardening
        eult: Strain at peak stress
    Returns:
        uniAxialMaterial:
"""

__author__ = "Domenico Gaudioso"
__contact__ = "DomenicoGaudioso@outlook.it"
__version__ = "2021.09.17"


ghenv.Component.Name = "uniaxial Elastic Material Reinforcing Steel (Alpaca4d)"
ghenv.Component.NickName = 'UEMRS'
ghenv.Component.Message = "uniaxial Reinforcing Steel (Alpaca4d)"

import sys
import Rhino.Geometry as rg
import Grasshopper as gh
import copy


## add alpaca install directory to system path

ghcompfolder = gh.Folders.DefaultAssemblyFolder
if ghcompfolder not in sys.path:
    sys.path.append(ghcompfolder)


   
   
try:
    from Alpaca4d import alpaca4d as alpaca
except:
    msg = "Cannot import Alpaca4d. Is the Alpaca4d folder available in " + ghcompfolder + "?"
    ghenv.Component.AddRuntimeMessage(gh.Kernel.GH_RuntimeMessageLevel.Error, msg)


checkData = True

if not fy:
    checkData = False
    msg = "Input parameter fy failed to collect data"
    ghenv.Component.AddRuntimeMessage(gh.Kernel.GH_RuntimeMessageLevel.Warning, msg)

if not fu:
    checkData = False
    msg = "Input parameter fu failed to collect data"
    ghenv.Component.AddRuntimeMessage(gh.Kernel.GH_RuntimeMessageLevel.Warning, msg)
    
if not Es:
    checkData = False
    msg = "Input parameter Es failed to collect data"
    ghenv.Component.AddRuntimeMessage(gh.Kernel.GH_RuntimeMessageLevel.Warning, msg)
"""
if not Esh:
    checkData = False
    msg = "Input parameter Esh failed to collect data"
    ghenv.Component.AddRuntimeMessage(gh.Kernel.GH_RuntimeMessageLevel.Warning, msg)
"""
if not esh:
    checkData = False
    msg = "Input parameter esh failed to collect data"
    ghenv.Component.AddRuntimeMessage(gh.Kernel.GH_RuntimeMessageLevel.Warning, msg)

if not eult:
    checkData = False
    msg = "Input parameter eult failed to collect data"
    ghenv.Component.AddRuntimeMessage(gh.Kernel.GH_RuntimeMessageLevel.Warning, msg)


if checkData:
    uniAxialMaterial = alpaca.uniAxialMaterialRSteel(name, MinMax, fy, fu, Es, Esh, esh, eult)
# ---------- end uemrs ----------
uems01 = UniaxialElasticMaterialSteel01Alpaca4d(MinMax=minmax.MinMax, fy="1", E0="1", b="1")  # -> out, uniAxialMaterial
# ---------- uems01: Python ----------
"""
Create a uniaxial Elastic Material Concreate01
-
    Args:
        fc:
        fcu:
        ec0:
        ecu:
    Returns:
        uniAxialMaterial:
"""

__author__ = "Domenico Gaudioso"
__contact__ = "DomenicoGaudioso@outlook.it"
__version__ = "2021.09.17"

ghenv.Component.Name = "uniaxial Elastic Material Steel01 (Alpaca4d)"
ghenv.Component.NickName = 'UEMS01'
ghenv.Component.Message = "uniaxial Steel01 (Alpaca4d)"

import sys
import Rhino.Geometry as rg
import Grasshopper as gh
import copy


## add alpaca install directory to system path

ghcompfolder = gh.Folders.DefaultAssemblyFolder
if ghcompfolder not in sys.path:
    sys.path.append(ghcompfolder)


   
   
try:
    from Alpaca4d import alpaca4d as alpaca
except:
    msg = "Cannot import Alpaca4d. Is the Alpaca4d folder available in " + ghcompfolder + "?"
    ghenv.Component.AddRuntimeMessage(gh.Kernel.GH_RuntimeMessageLevel.Error, msg)

print(a1!=None, a2, a3, a4)

checkData = True

if not fy:
    checkData = False
    msg = "Input parameter fy failed to collect data"
    ghenv.Component.AddRuntimeMessage(gh.Kernel.GH_RuntimeMessageLevel.Warning, msg)

if not E0:
    checkData = False
    msg = "Input parameter E0 failed to collect data"
    ghenv.Component.AddRuntimeMessage(gh.Kernel.GH_RuntimeMessageLevel.Warning, msg)
    
"""
if not b:
    checkData = False
    msg = "Input parameter b failed to collect data"
    ghenv.Component.AddRuntimeMessage(gh.Kernel.GH_RuntimeMessageLevel.Warning, msg)
"""

if checkData:
    uniAxialMaterial = alpaca.uniAxialMaterialSteel01(name, MinMax, fy, E0, b, a1, a2, a3, a4)
# ---------- end uems01 ----------

explode_2 = Explode(Curve=rectangle.Rectangle, Recursive=True)  # -> Segments, Vertices
number_slider_5 = Slider(2, range=0..10)
item_2 = ListItem(List=explode_2.Segments, Index=0, Wrap=True)  # -> Item, Item1, Item2, Item3
pt = ConstructPoint(XCoordinate=number_slider_5, YCoordinate=number_slider_5, ZCoordinate=0)
end = EndPoints(Curve=item_2.Item)  # -> Start, End
end_2 = EndPoints(Curve=item_2.Item1)  # -> Start, End
rectangle_2 = Rectangle(Plane=PlaneXY(0, 0, 0), XSize=Domain(-1, 1), YSize=Domain(-2, 2), Radius=0)  # -> Rectangle, Length
pi = Pi(Factor=Slider(1, range=0..10))
pi_2 = Pi(Factor=1)
offset_2 = OffsetCurve(Curve=rectangle_2.Rectangle, Distance=1, Plane=PlaneXY(0, 0, 0), Corners=1)
pt_2 = ConstructPoint(XCoordinate=0, YCoordinate=0, ZCoordinate=0)
line = LineSDL(Start=pt_2, Direction=Vector(0, 0, 1), Length=1)
aligndim = AlignedDimension(
    Plane=PlaneXY(0, 0, 0),
    PointA=end.Start,
    PointB=end.End,
    Offset=Slider(-0.1, range=-10..10),
    Text="{0:0.00}",
    Size="0.02")
aligndim_2 = AlignedDimension(
    Plane=PlaneXY(0, 0, 0),
    PointA=end_2.Start,
    PointB=end_2.End,
    Offset=Slider(-0.1, range=-10..10),
    Text="{0:0.00}",
    Size="0.02")
lc = LayerCircAlpaca4d(material=uemc01.uniAxialMaterial, pointCenter=pt)  # -> out, layer, layerCircle; inputs pointCenter: Point3d, nBar: Int32, diameter: Int32
# ---------- lc: Python ----------
"""
Create path
-
    Args:
        material: material component.
        pointCenter: center circle (default 0,0,0)
        nBar: number of fibers along circle 
        diameter: 	diameter bar 
        radius: radius of circle
        startAng: starting angle
        endAng: ending angle
            
            Inputs:
                
                
                
            
    Returns:
        uniAxialMaterial:
"""
__author__ = "Domenico Gaudioso"
__contact__ = "DomenicoGaudioso@outlook.it"
__version__ = "2021.09.17"

ghenv.Component.Name = "layer circ(Alpaca4d)"
ghenv.Component.NickName = 'lc'
ghenv.Component.Message = "layer circ(Alpaca4d)"

import sys
import Rhino.Geometry as rg
import Grasshopper as gh
import copy


## add alpaca install directory to system path

ghcompfolder = gh.Folders.DefaultAssemblyFolder
if ghcompfolder not in sys.path:
    sys.path.append(ghcompfolder)

try:
    from Alpaca4d import alpaca4d as alpaca
except:
    msg = "Cannot import Alpaca4d. Is the Alpaca4d folder available in " + ghcompfolder + "?"
    ghenv.Component.AddRuntimeMessage(gh.Kernel.GH_RuntimeMessageLevel.Error, msg)


checkData = True

if not material:
    checkData = False
    msg = "Input parameter material failed to collect data"
    ghenv.Component.AddRuntimeMessage(gh.Kernel.GH_RuntimeMessageLevel.Warning, msg)

if not nBar:
    checkData = False
    msg = "Input parameter nBar failed to collect data"
    ghenv.Component.AddRuntimeMessage(gh.Kernel.GH_RuntimeMessageLevel.Warning, msg)

if not diameter:
    checkData = False
    msg = "Input parameter diameter failed to collect data"
    ghenv.Component.AddRuntimeMessage(gh.Kernel.GH_RuntimeMessageLevel.Warning, msg)
    
if not radius:
    checkData = False
    msg = "Input parameter radius failed to collect data"
    ghenv.Component.AddRuntimeMessage(gh.Kernel.GH_RuntimeMessageLevel.Warning, msg)
    
if not startAng:
    checkData = False
    msg = "Input parameter startAng failed to collect data"
    ghenv.Component.AddRuntimeMessage(gh.Kernel.GH_RuntimeMessageLevel.Warning, msg)
    
if not endAng:
    checkData = False
    msg = "Input parameter endAng failed to collect data"
    ghenv.Component.AddRuntimeMessage(gh.Kernel.GH_RuntimeMessageLevel.Warning, msg)
    
import rhinoscriptsyntax as rs
import Rhino.Geometry as rg
import math as mt
import ghpythonlib.components as ghcomp

#a = rg.Mesh.CreateFromSurface(surf4N, rg.MeshingParameters.Default)
def linspace(start, stop, len):
    step = (mt.fabs(start)+stop)/(len-1)
    return [start + step*interval for interval in range(len)]
    
if pointCenter == None:
    pointCenter = rg.Point3d(0.0, 0.0, 0.0)

if checkData:
    mat = copy.copy(material)
    layer = alpaca.layerCirc(mat, pointCenter, nBar, diameter, radius, startAng, endAng)
    layerCircle = layer.layerCircle
# ---------- end lc ----------
# aggiungere i colori e fare la path a Mesh
P = PathAlpaca4d(material=uemc01.uniAxialMaterial, polyC=rectangle_2.Rectangle, U=Slider(4, range=0..10), V=Slider(4, range=0..10))  # -> out, path, pathSurf; inputs polyC: Curve, U: Int32, V: Int32
# ---------- P: Python ----------
"""
Create path
-
    Args:
        material: material component.
        polyC: polyline with 4 node (only 4 node).
        U:  number of subdivisions (fibers) in the IJ direction.
        V: 	number of subdivisions (fibers) in the JK direction.
            Inputs:
                
                
                
            
    Returns:
        uniAxialMaterial:
"""

__author__ = "Domenico Gaudioso"
__contact__ = "DomenicoGaudioso@outlook.it"
__version__ = "2021.09.17"

ghenv.Component.Name = "path (Alpaca4d)"
ghenv.Component.NickName = 'P'
ghenv.Component.Message = "path (Alpaca4d)"

import sys
import Rhino.Geometry as rg
import Grasshopper as gh
import copy


## add alpaca install directory to system path

ghcompfolder = gh.Folders.DefaultAssemblyFolder
if ghcompfolder not in sys.path:
    sys.path.append(ghcompfolder)

try:
    from Alpaca4d import alpaca4d as alpaca
except:
    msg = "Cannot import Alpaca4d. Is the Alpaca4d folder available in " + ghcompfolder + "?"
    ghenv.Component.AddRuntimeMessage(gh.Kernel.GH_RuntimeMessageLevel.Error, msg)


checkData = True

if not material:
    checkData = False
    msg = "Input parameter material failed to collect data"
    ghenv.Component.AddRuntimeMessage(gh.Kernel.GH_RuntimeMessageLevel.Warning, msg)

if not polyC:
    checkData = False
    msg = "Input parameter polyC failed to collect data"
    ghenv.Component.AddRuntimeMessage(gh.Kernel.GH_RuntimeMessageLevel.Warning, msg)

if not U:
    checkData = False
    msg = "Input parameter U failed to collect data"
    ghenv.Component.AddRuntimeMessage(gh.Kernel.GH_RuntimeMessageLevel.Warning, msg)

if not V:
    checkData = False
    msg = "Input parameter V failed to collect data"
    ghenv.Component.AddRuntimeMessage(gh.Kernel.GH_RuntimeMessageLevel.Warning, msg)

import rhinoscriptsyntax as rs
import Rhino.Geometry as rg
import ghpythonlib.components as ghcomp

#a = rg.Mesh.CreateFromSurface(surf4N, rg.MeshingParameters.Default)


class path(object):
    def __init__(self, material, polyC, U, V):
        """ Generate fiber
            link for information: https://opensees.berkeley.edu/wiki/index.php/Patch_Command
            Inputs:
                matName: Name of the material.
                U:  number of subdivisions (fibers) in the IJ direction.
                V: 	number of subdivisions (fibers) in the JK direction.
        """
        
        self.material = material
        self.polyC = polyC
        self.U = U 
        self.V = V
        
        self.Point = [polyC.Point(i) for i in range(0,4)]
        # Da perfezionare per far avere sempre la stessa direzione
        if self.Point[0].X <= self.Point[1].X:
            print("direction mesh is good")
            
        else:
            print( "non va bene" )
            self.Point.reverse()
            
        self.surf = ghcomp.MeshSurface(polyC, self.U, self.V, True, True)

    def ToString(self):
        return self.write_tcl()

    def write_tcl(self):
        return "patch quad {} {} {} {} {} {} {} {} {} {} {};\n".format(self.material.matTag, self.U, self.V, self.Point[0].X, self.Point[0].Y, self.Point[1].X, self.Point[1].Y, self.Point[2].X, self.Point[2].Y, self.Point[3].X, self.Point[3].Y  )

if checkData:
    mat = copy.copy(material)
    path = alpaca.path(mat, polyC, U, V)
    pathSurf = path.surf
# ---------- end P ----------
l = LayerAlpaca4d(material=uemc01.uniAxialMaterial, line=offset_2, nBar=Slider(4, range=0..10), diameter=Slider(12, range=0..100))  # -> out, layer, layerCircle; inputs line: Curve, nBar: Int32, diameter: Int32
# ---------- l: Python ----------
"""
Create path
-
    Args:
        material: material component.
        line: line 
        nBar:  number of fibers along line
        diameter: 	diameter bar
            Inputs:
                
                
                
            
    Returns:
        uniAxialMaterial:
"""

__author__ = "Domenico Gaudioso"
__contact__ = "DomenicoGaudioso@outlook.it"
__version__ = "2021.09.17"

ghenv.Component.Name = "layer (Alpaca4d)"
ghenv.Component.NickName = 'l'
ghenv.Component.Message = "layer (Alpaca4d)"

import sys
import Rhino.Geometry as rg
import Grasshopper as gh
import copy


## add alpaca install directory to system path

ghcompfolder = gh.Folders.DefaultAssemblyFolder
if ghcompfolder not in sys.path:
    sys.path.append(ghcompfolder)

try:
    from Alpaca4d import alpaca4d as alpaca
except:
    msg = "Cannot import Alpaca4d. Is the Alpaca4d folder available in " + ghcompfolder + "?"
    ghenv.Component.AddRuntimeMessage(gh.Kernel.GH_RuntimeMessageLevel.Error, msg)


checkData = True

if not material:
    checkData = False
    msg = "Input parameter material failed to collect data"
    ghenv.Component.AddRuntimeMessage(gh.Kernel.GH_RuntimeMessageLevel.Warning, msg)

if not line:
    checkData = False
    msg = "Input parameter line failed to collect data"
    ghenv.Component.AddRuntimeMessage(gh.Kernel.GH_RuntimeMessageLevel.Warning, msg)

if not nBar:
    checkData = False
    msg = "Input parameter nBar failed to collect data"
    ghenv.Component.AddRuntimeMessage(gh.Kernel.GH_RuntimeMessageLevel.Warning, msg)

if not diameter:
    checkData = False
    msg = "Input parameter diameter failed to collect data"
    ghenv.Component.AddRuntimeMessage(gh.Kernel.GH_RuntimeMessageLevel.Warning, msg)

import rhinoscriptsyntax as rs
import Rhino.Geometry as rg
import math as mt
import ghpythonlib.components as ghcomp

def linspace(start, stop, len):
    step = (mt.fabs(start)+stop)/(len-1)
    return [start + step*interval for interval in range(len)]
    
if checkData:
    mat = copy.copy(material)
    layer = alpaca.layer(mat, line, nBar, diameter)
    layerCircle = layer.layerSurf
# ---------- end l ----------
pc = PathCircAlpaca4d(
    material=uemc01.uniAxialMaterial,
    pointCenter=pt,
    nDivideCirc=Slider(4, range=0..10),
    nDivideRad=Slider(9, range=0..100),
    intRad=Slider(8, range=0..10),
    extRad=Slider(22, range=0..100),
    startAng=pi_2,
    endAng=pi)  # -> out, path, pathGeo; inputs pointCenter: Point3d, nDivideCirc: Int32, nDivideRad: Int32
# ---------- pc: Python ----------
"""
Create path
-
    Args:
        material: material component.
        pointCenter: center circle (default is 0,0,0)
        nDivideCirc: number of subdivisions (fibers) in the IJ direction.
        nDivideRad: number of subdivisions (fibers) in the JK direction.
        intRad: internal radius
        extRad:	external radius
        startAng: starting angle
        endAng: ending angle
            
            Inputs:
                
                
                
            
    Returns:
        uniAxialMaterial:
"""

__author__ = "Domenico Gaudioso"
__contact__ = "DomenicoGaudioso@outlook.it"
__version__ = "2021.09.17"

ghenv.Component.Name = "path circ(Alpaca4d)"
ghenv.Component.NickName = 'Pc'
ghenv.Component.Message = "path circ(Alpaca4d)"

import sys
import Rhino.Geometry as rg
import math as mt
import Grasshopper as gh
import copy


## add alpaca install directory to system path

ghcompfolder = gh.Folders.DefaultAssemblyFolder
if ghcompfolder not in sys.path:
    sys.path.append(ghcompfolder)

try:
    from Alpaca4d import alpaca4d as alpaca
except:
    msg = "Cannot import Alpaca4d. Is the Alpaca4d folder available in " + ghcompfolder + "?"
    ghenv.Component.AddRuntimeMessage(gh.Kernel.GH_RuntimeMessageLevel.Error, msg)

checkData = True

if not material:
    checkData = False
    msg = "Input parameter material failed to collect data"
    ghenv.Component.AddRuntimeMessage(gh.Kernel.GH_RuntimeMessageLevel.Warning, msg)

if not intRad:
    checkData = False
    msg = "Input parameter intRad failed to collect data"
    ghenv.Component.AddRuntimeMessage(gh.Kernel.GH_RuntimeMessageLevel.Warning, msg)

if not extRad:
    checkData = False
    msg = "Input parameter intRad failed to collect data"
    ghenv.Component.AddRuntimeMessage(gh.Kernel.GH_RuntimeMessageLevel.Warning, msg)


import rhinoscriptsyntax as rs
import Rhino.Geometry as rg

if pointCenter == None:
    pointCenter = rg.Point3d(0.0, 0.0, 0.0)
    
def linspace(start, stop, len):
    step = (mt.fabs(start)+stop)/(len-1)
    return [start + step*interval for interval in range(len)]

path = alpaca.pathCirc(material, intRad, extRad, pointCenter, nDivideCirc , nDivideRad , startAng , endAng )

pathGeo = path.pathGeo
# ---------- end pc ----------
f = FiberAlpaca4d(material=uemc01.uniAxialMaterial, point=pt_2, area=Slider(2, range=0..10))  # -> out, fiber; inputs point: Point3d
# ---------- f: Python ----------
"""
Create fiber
-
    Args:
        material: material component.
        point: point
        area:  area
            Inputs:
                
                
                
            
    Returns:
        uniAxialMaterial:
"""

__author__ = "Domenico Gaudioso"
__contact__ = "DomenicoGaudioso@outlook.it"
__version__ = "2021.09.17"


ghenv.Component.Name = "fiber (Alpaca4d)"
ghenv.Component.NickName = 'f'
ghenv.Component.Message = "fiber (Alpaca4d)"

import sys
import Rhino.Geometry as rg
import Grasshopper as gh
import copy


## add alpaca install directory to system path

ghcompfolder = gh.Folders.DefaultAssemblyFolder
if ghcompfolder not in sys.path:
    sys.path.append(ghcompfolder)

try:
    from Alpaca4d import alpaca4d as alpaca
except:
    msg = "Cannot import Alpaca4d. Is the Alpaca4d folder available in " + ghcompfolder + "?"
    ghenv.Component.AddRuntimeMessage(gh.Kernel.GH_RuntimeMessageLevel.Error, msg)


checkData = True

if not material:
    checkData = False
    msg = "Input parameter material failed to collect data"
    ghenv.Component.AddRuntimeMessage(gh.Kernel.GH_RuntimeMessageLevel.Warning, msg)

if not point:
    checkData = False
    msg = "Input parameter point failed to collect data"
    ghenv.Component.AddRuntimeMessage(gh.Kernel.GH_RuntimeMessageLevel.Warning, msg)

if not area:
    checkData = False
    msg = "Input parameter area failed to collect data"
    ghenv.Component.AddRuntimeMessage(gh.Kernel.GH_RuntimeMessageLevel.Warning, msg)

import rhinoscriptsyntax as rs
import Rhino.Geometry as rg
import ghpythonlib.components as ghcomp

#a = rg.Mesh.CreateFromSurface(surf4N, rg.MeshingParameters.Default)

if checkData:
    mat = copy.copy(material)
    fiber = alpaca.fiber(mat, point, area)
# ---------- end f ----------
panel_2 = Panel(pc.path)
panel_3 = Panel(lc.layer)
python = GhPythonScript(path=flatten(P.path), layer=flatten(l.layer))  # -> out, FiberSection, FiberMesh, PropSection; inputs fiber: list, path: list, layer: list
# ---------- python: Python ----------
__author__ = "Domenico Gaudioso"
__contact__ = "DomenicoGaudioso@outlook.it"
__version__ = "2021.09.17"

import rhinoscriptsyntax as rs
import Grasshopper as gh
import ghpythonlib.components as ghcomp
import Rhino.Geometry as rg
import math as mt
import sys
import Rhino.Geometry as rg
import Grasshopper as gh
import copy

## add alpaca install directory to system path

ghcompfolder = gh.Folders.DefaultAssemblyFolder
if ghcompfolder not in sys.path:
    sys.path.append(ghcompfolder)

try:
    from Alpaca4d import alpaca4d as alpaca
except:
    msg = "Cannot import Alpaca4d. Is the Alpaca4d folder available in " + ghcompfolder + "?"
    ghenv.Component.AddRuntimeMessage(gh.Kernel.GH_RuntimeMessageLevel.Error, msg)
"""
if not fiber:
    checkData = False
    msg = "Input parameter fiber failed to collect data"
    ghenv.Component.AddRuntimeMessage(gh.Kernel.GH_RuntimeMessageLevel.Warning, msg)

if not path:
    checkData = False
    msg = "Input parameter path failed to collect data"
    ghenv.Component.AddRuntimeMessage(gh.Kernel.GH_RuntimeMessageLevel.Warning, msg)

if not layer:
    checkData = False
    msg = "Input parameter layer failed to collect data"
    ghenv.Component.AddRuntimeMessage(gh.Kernel.GH_RuntimeMessageLevel.Warning, msg)
"""
FiberSection = alpaca.FiberSection(fiber, path, layer)
FiberMesh = FiberSection.mesh
PropSection = FiberSection.prop
print( FiberSection.ToString() )
# ---------- end python ----------
panel_4 = Panel(python.FiberSection)
mnm = MNModelAlpaca4d()  # -> out, N, M; inputs centerForce: Point3d, nPoint: Int32
# ---------- mnm: Python ----------
"""
Run an OpenSees Analysis
-
    Args:
        FiberSection:
        direction: 1 for M2 and 2 for M1. Default is 1 
        nPoint: number of Point for make de N-M domain
    Returns:
        N: axial load valor
        M: bending moment valor
"""



import Rhino.RhinoDoc
import Grasshopper as gh
import copy
import rhinoscriptsyntax as rs
import Rhino.Geometry as rg
import os
import time
import sys
import subprocess
import ghpythonlib.treehelpers as th
import math as mt
import ghpythonlib.parallel as ghp



ghenv.Component.Name = "M-N Model (Alpaca4d)"
ghenv.Component.NickName = 'MNM'
ghenv.Component.Message = "M-N Model (Alpaca4d)"

ghcompfolder = gh.Folders.DefaultAssemblyFolder
if ghcompfolder not in sys.path:
    sys.path.append(ghcompfolder)

try:
    from Alpaca4d import alpaca4d as alpaca
except:
    msg = "Cannot import Alpaca4d. Is the Alpaca4d folder available in " + ghcompfolder + "?"
    ghenv.Component.AddRuntimeMessage(gh.Kernel.GH_RuntimeMessageLevel.Error, msg)


checkData = True



if not FiberSection:
    checkData = False
    msg = "Input parameter AlpacaModel failed to collect data"
    ghenv.Component.AddRuntimeMessage(gh.Kernel.GH_RuntimeMessageLevel.Warning, msg)
    
if direction == None:
    direction = 1

if centerForce == None:
    centerForce = rg.Point3d(FiberSection.centerSection.X, FiberSection.centerSection.Y, FiberSection.centerSection.Z)

class MomentCurvature(object):
    def __init__(self, recorderName, section, axialLoad, alpha, maxPhi, numIncr=100):
        #^ y
        #|
        #|
        #|------> x
        self.recorderName = recorderName
        self.section = section
        self.axialLoad = axialLoad
        self.alpha = mt.radians(alpha)
        self.maxPhi = maxPhi
        self.numIncr= numIncr
        # Compute curvature increment
        #self.dK = self.maxK / self.numIncr
        self.secTag = 1
        

    def ToString(self):
        return self.write_tcl()

    def write_tcl(self):
        # Define two nodes at (0,0)
        clean = "wipe\n"
        model = "model BasicBuilder -ndm 3 -ndf 6\n"
        
        materialFiber = ''.join([ i.material.write_tcl() for i in self.section.fiber ])
        materialPath = ''.join([ i.material.write_tcl() for i in self.section.path ])
        materialLayer = ''.join([ i.material.write_tcl() for i in self.section.layer ])
        material = materialFiber + materialPath + materialLayer
        
        section = self.section.ToString()
        node1 = "node {} {} {} {}\n".format(1, 0.0, 0.0, 0.0)
        node2 = "node {} {} {} {}\n".format(2, 0.0, 0.0, 0.0)
        # Fix all degrees of freedom except axial and bending
        fix1 = "fix {} {} {} {} {} {} {}\n".format(1, 1, 1, 1, 1 ,1, 1) #node tag Fx Fy Fz Mx My Mz
        fix2 = "fix {} {} {} {} {} {} {}\n".format(2, 0, 1, 1, 1, 0, 0) #node tag Fx Fy Fz Mx My Mz
        # Define element
        ele = "element zeroLengthSection {} {} {} {} -orient 1 0 0 0 {} {}\n".format( 1, 1, 2, self.secTag, mt.cos(self.alpha), mt.sin(self.alpha)) #-orient 1 0 0 0 $cos $sin
        # Define constant axial load
        pattern = 'pattern Plain {} "{}" {}\n'.format( 1, 'Constant', "{;")   
        load = "load {} {} {} {} {} {} {};\n".format(2, self.axialLoad, 0.0, 0.0, 0.0, 0.0, 0.0) +  "}\n" 
        # analysis for constant axial load
        Integrator = "integrator LoadControl {}\n".format( 0.1)
        System = "system BandGeneral\n" #-piv
        Test = "test NormUnbalance {} {}\n".format( 1e-10, 1000)
        number = "numberer RCM\n"
        constraints = "constraints Plain\n"
        algorithm = "algorithm Newton\n"
        analysis = "analysis Static\n"
        # Do one analysis for constant axial load
        analyze = "analyze {}\n".format(10) 
        lC = "loadConst -time 0.0\n"
        # Define reference moment 
        recorderName1 = self.recorderName + "Force" + ".out"
        recorderName2 = self.recorderName + "Disp" + ".out"
        recorder1 = "recorder Element -file {} -ele 1 section force\n".format(recorderName1)
        #recorder2 = "recorder Element -file {} -ele 1 section deformation\n".format(recorderName2)
        patternM = 'pattern Plain {} "{}" {}\n'.format( 2, 'Linear', "{;")   
        # Use displacement control at node 2 for section analysis
        loadM = "load {} {} {} {} {} {} {};\n".format(2, 0.0, 0.0, 0.0, 0.0, 1.0, 0.0) +  "}\n" 
        IntegratorD = "integrator DisplacementControl {} {} {}\n".format(2, 5, self.maxPhi/self.numIncr)
        #IntegratorD = 'integrator ' + self.Integrator.ToString() + "\n"
        analyze2 = "analyze {}\n".format(self.numIncr) + "\n" + "wipe"+ "\n"

        return clean + model + material + section +  node1 + node2 + fix1 + fix2 + ele + pattern + load + Integrator + System + Test + number + constraints + algorithm + analysis + analyze +lC + recorder1 + patternM + loadM + IntegratorD + analyze2


def RunMCpositive(Pi): 
    if Pi > 0.0:
        recorderFileName = "MKsectionP{}positiveMpositive".format(int(mt.fabs(Pi)))
        outputFileName = "OSSModel{}positiveMpositive".format(int(mt.fabs(Pi)))
    elif Pi < 0.0:
        recorderFileName = "MKsectionP{}negativeMpositive".format(int(mt.fabs(Pi)))
        outputFileName = "OSSModel{}negativeMpositive".format(int(mt.fabs(Pi)))
        
    if direction == 1:
        alpha = 0.0
    else:
        alpha = 90.0
            
    MC = MomentCurvature(recorderFileName,FiberSection, float(Pi), alpha, 2.0, 1000) #mu*FiberSection.Ky
    script = MC.write_tcl()
    
    FolderPath = rs.DocumentPath()
    os.chdir(FolderPath)
        
    recorderFileName1 = recorderFileName + "Force" + ".out"
    recorderFileName2 = recorderFileName + "Disp" + ".out"
    
    runFileName = os.path.join(FolderPath,outputFileName)
    filepath1 = os.path.join(FolderPath,recorderFileName1)
    #filepath2 = os.path.join(FolderPath,recorderFileName2)
    """
    if os.path.exists(runFileName):
      os.remove(runFileName)
      os.remove(filepath1)
      os.remove(filepath1)
    else:
      print("The file does not exist")
    """
    time_start = time.clock()
    
    with open(outputFileName, 'w') as f:
        for line in MC.write_tcl():
            f.write(line)
        f.close()
    
    time_elapsed = (time.clock() - time_start)
    #print("Writing Time {}".format(time_elapsed))
    
    time_start = time.clock()
    
    executable = os.path.join(ghcompfolder,'Alpaca4d\OpenSees-Solvers\opensees.bat')
    #executable = os.path.join(ghcompfolder,'C:\OpenSees\bin\opensees.bat')
    
    #process = subprocess.Popen([r'C:\OpenSees\bin\OpenSees', outputFileName], shell = True, stdout=subprocess.PIPE, stderr=subprocess.PIPE)
    process = subprocess.Popen([executable, outputFileName], shell = True,  stdout=subprocess.PIPE, stderr=subprocess.PIPE)
    stdout, stderr = process.communicate()
    #print(stdout, stderr)
    process.kill()
    os.remove(runFileName)
    time_elapsed = (time.clock() - time_start)
    #print("Analyses Time {}".format(time_elapsed))
    #filepath = os.path.join(r'C:\OpenSees\bin',recorderFileName)
    fileObj = open(filepath1, 'r')
    words = fileObj.read().splitlines(" ")
    #print(fileObj.read())
    N = "None"
    if len(words) != 0:
        N = float(words[-1].split()[0])
        M1 = float(words[-1].split()[1])
        M2 = float(words[-1].split()[2])
    fileObj.close()

    os.remove(filepath1)
    """
    fileObj = open(filepath2, 'r')
    words = fileObj.read().splitlines(" ")
    #print(fileObj.read())

    k1 = [ float(i.split()[1]) for i in words]
    k2 = [ float(i.split()[2]) for i in words]
    k3 = [ float(i.split()[3]) for i in words]
    fileObj.close()
    """
    #os.remove(filepath2)
    if N != "None" :
        return [N, M1, M2]


def RunMCnegative(Pi): 

    if Pi > 0.0:
        recorderFileName = "MKsectionP{}positiveMnegative".format(int(mt.fabs(Pi)))
        outputFileName = "OSSModel{}positiveMnegative".format(int(mt.fabs(Pi)))
    elif Pi < 0.0:
        recorderFileName = "MKsectionP{}negativeMnegative".format(int(mt.fabs(Pi)))
        outputFileName = "OSSModel{}negativeMnegative".format(int(mt.fabs(Pi)))
        
    if direction == 1:
        alpha = 180.00
    else:
        alpha = 270.00
            
    MC = MomentCurvature(recorderFileName,FiberSection, float(Pi), alpha, 2.0, 1000)
    script = MC.write_tcl()
    
    FolderPath = rs.DocumentPath()
    os.chdir(FolderPath)
        
    recorderFileName1 = recorderFileName + "Force" + ".out"
    recorderFileName2 = recorderFileName + "Disp" + ".out"
    
    runFileName = os.path.join(FolderPath,outputFileName)
    filepath1 = os.path.join(FolderPath,recorderFileName1)
    #filepath2 = os.path.join(FolderPath,recorderFileName2)
    """
    if os.path.exists(runFileName):
      os.remove(runFileName)
      os.remove(filepath1)
      os.remove(filepath1)
    else:
      print("The file does not exist")
      """
    time_start = time.clock()
    
    with open(outputFileName, 'w') as f:
        for line in MC.write_tcl():
            f.write(line)
        f.close()
    
    time_elapsed = (time.clock() - time_start)
    #print("Writing Time {}".format(time_elapsed))
    
    time_start = time.clock()
    
    executable = os.path.join(ghcompfolder,'Alpaca4d\OpenSees-Solvers\opensees.bat')
    #executable = os.path.join(ghcompfolder,'C:\OpenSees\bin\opensees.bat')
    
    #process = subprocess.Popen([r'C:\OpenSees\bin\OpenSees', outputFileName], shell = True, stdout=subprocess.PIPE, stderr=subprocess.PIPE)
    process = subprocess.Popen([executable, outputFileName], shell = True,  stdout=subprocess.PIPE, stderr=subprocess.PIPE)
    stdout, stderr = process.communicate()
    #print(stdout, stderr)
    process.kill()
    os.remove(runFileName)
    time_elapsed = (time.clock() - time_start)
    #print("Analyses Time {}".format(time_elapsed))
    #filepath = os.path.join(r'C:\OpenSees\bin',recorderFileName)
    fileObj = open(filepath1, 'r')
    words = fileObj.read().splitlines(" ")
    #print(fileObj.read())
    N = "None"
    if len(words) != 0:
        N = float(words[-1].split()[0])
        M1 = float(words[-1].split()[1])
        M2 = float(words[-1].split()[2])
    fileObj.close()

    os.remove(filepath1)
    """
    fileObj = open(filepath2, 'r')
    words = fileObj.read().splitlines(" ")
    #print(fileObj.read())

    k1 = [ float(i.split()[1]) for i in words]
    k2 = [ float(i.split()[2]) for i in words]
    k3 = [ float(i.split()[3]) for i in words]
    fileObj.close()
    """
    #os.remove(filepath2)
    if N != "None" :
        return [N, M1, M2]
        
        

        
if checkData:
    FiberSection.secTag = 1
    for i, item in enumerate(FiberSection.path):
        item.material.matTag = 2*(i+1)
        item.material.matTagMinMax = 2*i+1
        #print(item.material.matTag )
    j = i+2
    for i, item in enumerate(FiberSection.layer):
        j = j + i 
        item.material.matTag = 2*(j+1)
        item.material.matTagMinMax = 2*j+1
        #print(j+i)
    w = j+2
    for i, item in enumerate(FiberSection.fiber):
        w = w + i 
        item.material.matTag = 2*(w+1)
        item.material.matTagMinMax = 2*w+1
        
#A = ghp.run(RunNEps,[-1.0, 1.0], True)


def linspace(start, stop, len):
    step = (mt.fabs(start)+stop)/(len-1)
    return [start + step*interval for interval in range(len)]
    
print(FiberSection.NultNeg+0.1*FiberSection.NultNeg,FiberSection.NultPos)


#n1 = int(mt.fabs(min(A)/stepValorPositive))
#n2 = int(mt.fabs(max(A)/stepValorNegative))

#listP = linspace(min(A), -5.0, n1) + linspace(5, max(A)-10.0, n2)

if nPoint == None:
    nPoint = 10
    
listP = linspace(FiberSection.NultNeg,FiberSection.NultPos, nPoint)


B = ghp.run(RunMCpositive, listP,False)
C = ghp.run(RunMCnegative, listP,False)

#print(D[7])
#RunM1Cpositive(Pi): 


Nupos, Nuneg = [], []
M1uP, M2uP = [], []
M1uN, M2uN = [], []

B =filter(None, B) #elimino il None
C =filter(None, C) 

for item in B:
    Nupos.append(item[0])
    M1uP.append( item[1])
    M2uP.append( item[2])
    #M3uP.append( item[3])
    
for item in C:
    Nuneg.append(item[0])
    M1uN.append( item[1])
    M2uN.append( item[2])

M1 = M1uN + M1uP[::-1] + M1uN[0:1]
M2 = M2uN + M2uP[::-1] + M2uN[0:1]
N = Nuneg + Nupos[::-1] + Nuneg[0:1]

if direction == 1:
    M = M2
else:
    M = M1
# ---------- end mnm ----------
mcm = MomentCurvatureModelAlpaca4d(FiberSection=python.FiberSection)  # -> out, script, k1, k2, M1, M2; inputs nIncr: Int32
# ---------- mcm: Python ----------
"""
Run an OpenSees Analysis
-
    Args:
        FiberSection:
        P: axial load 
        mu: Target ductility for analysis
        nIncr: Number of analysis increments
    Returns:
        AlpacaSolvedModel:
"""



import Rhino.RhinoDoc
import Grasshopper as gh
import copy
import rhinoscriptsyntax as rs
import Rhino.Geometry as rg
import os
import time
import sys
import subprocess
import math as mt



ghenv.Component.Name = "Moment Curvature Model (Alpaca4d)"
ghenv.Component.NickName = 'MCM'
ghenv.Component.Message = "Moment Curvature Model (Alpaca4d)"

ghcompfolder = gh.Folders.DefaultAssemblyFolder
if ghcompfolder not in sys.path:
    sys.path.append(ghcompfolder)

try:
    from Alpaca4d import alpaca4d as alpaca
except:
    msg = "Cannot import Alpaca4d. Is the Alpaca4d folder available in " + ghcompfolder + "?"
    ghenv.Component.AddRuntimeMessage(gh.Kernel.GH_RuntimeMessageLevel.Error, msg)


checkData = True



if not FiberSection:
    checkData = False
    msg = "Input parameter AlpacaModel failed to collect data"
    ghenv.Component.AddRuntimeMessage(gh.Kernel.GH_RuntimeMessageLevel.Warning, msg)
if not P: #
    checkData = False
    msg = "Input parameter P failed to collect data"
    ghenv.Component.AddRuntimeMessage(gh.Kernel.GH_RuntimeMessageLevel.Warning, msg)
    
if not alpha: #
    checkData = False
    msg = "Input parameter alpha failed to collect data"
    ghenv.Component.AddRuntimeMessage(gh.Kernel.GH_RuntimeMessageLevel.Warning, msg)

if not maxPhi: #
    checkData = False
    msg = "Input parameter maxPhi failed to collect data"
    ghenv.Component.AddRuntimeMessage(gh.Kernel.GH_RuntimeMessageLevel.Warning, msg)

if not nIncr: #
    checkData = False
    msg = "Input parameter nIncr failed to collect data"
    ghenv.Component.AddRuntimeMessage(gh.Kernel.GH_RuntimeMessageLevel.Warning, msg)
    
class MomentCurvature(object):
    def __init__(self, section, axialLoad, alpha, maxPhi, numIncr=100):
        #^ y
        #|
        #|
        #|------> x
        self.section = section
        self.axialLoad = axialLoad
        self.alpha = mt.radians(alpha)
        self.maxPhi = maxPhi
        self.numIncr= numIncr
        # Compute curvature increment
        #self.dK = self.maxK / self.numIncr
        self.secTag = 1
        

    def ToString(self):
        return self.write_tcl()

    def write_tcl(self):
        # Define two nodes at (0,0)
        clean = "wipe\n"
        model = "model BasicBuilder -ndm 3 -ndf 6\n"
        
        materialFiber = ''.join([ i.material.write_tcl() for i in self.section.fiber ])
        materialPath = ''.join([ i.material.write_tcl() for i in self.section.path ])
        materialLayer = ''.join([ i.material.write_tcl() for i in self.section.layer ])
        material = materialFiber + materialPath + materialLayer
        
        section = self.section.ToString()
        node1 = "node {} {} {} {}\n".format(1, self.section.centerSection.X, self.section.centerSection.Y, self.section.centerSection.Z)
        node2 = "node {} {} {} {}\n".format(2, self.section.centerSection.X, self.section.centerSection.Y, self.section.centerSection.Z)
        # Fix all degrees of freedom except axial and bending
        fix1 = "fix {} {} {} {} {} {} {}\n".format(1, 1, 1, 1, 1 ,1, 1) #node tag Fx Fy Fz Mx My Mz
        fix2 = "fix {} {} {} {} {} {} {}\n".format(2, 0, 1, 1, 1, 0, 0) #node tag Fx Fy Fz Mx My Mz
        # Define element
        ele = "element zeroLengthSection {} {} {} {} -orient 1 0 0 0 {} {}\n".format( 1, 1, 2, self.secTag, mt.cos(self.alpha), mt.sin(self.alpha)) #-orient 1 0 0 0 $cos $sin
        # Define constant axial load
        pattern = 'pattern Plain {} "{}" {}\n'.format( 1, 'Constant', "{;")   
        load = "load {} {} {} {} {} {} {};\n".format(2, self.axialLoad, 0.0, 0.0, 0.0, 0.0, 0.0) +  "}\n" 
        # analysis for constant axial load
        Integrator = "integrator LoadControl {}\n".format( 0.1)
        System = "system BandGeneral\n" #-piv
        Test = "test NormUnbalance {} {}\n".format( 1e-10, 1000)
        number = "numberer RCM\n"
        constraints = "constraints Plain\n"
        algorithm = "algorithm Newton\n"
        analysis = "analysis Static\n"
        # Do one analysis for constant axial load
        analyze = "analyze {}\n".format(10) 
        lC = "loadConst -time 0.0\n"
        # Define reference moment 
        recorder1 = "recorder Element -file MKsectionForce.out -ele 1 section force\n"
        recorder2 = "recorder Element -file MKsectionDef.out -ele 1 section deformation\n"
        patternM = 'pattern Plain {} "{}" {}\n'.format( 2, 'Linear', "{;")   
        # Use displacement control at node 2 for section analysis
        loadM = "load {} {} {} {} {} {} {};\n".format(2, 0.0, 0.0, 0.0, 0.0, 1.0, 0.0) +  "}\n" 
        IntegratorD = "integrator DisplacementControl {} {} {}\n".format(2, 5, self.maxPhi/self.numIncr)
        analyze2 = "analyze {}\n".format(self.numIncr) + "\n" + "wipe"+ "\n"

        return clean + model + material + section +  node1 + node2 + fix1 + fix2 + ele + pattern + load + Integrator + System + Test + number + constraints + algorithm + analysis + analyze +lC + recorder1+ recorder2 + patternM + loadM + IntegratorD + analyze2


    def write_py(self):
        # Define two nodes at (0,0)


        return node1 + node2 + fix1 + fix2 + ele  + timeSeries + pattern + load + Integrator + System + test + number + constraints + algorithm + analysis + analyze + timeSeriesM + patternM + loadM + IntegratorD + analyze2

if checkData:
    FiberSection.secTag = 1
    for i, item in enumerate(FiberSection.path):
        item.material.matTag = 2*(i+1)
        item.material.matTagMinMax = 2*i+1
        #print(item.material.matTag )
    j = i+2
    for i, item in enumerate(FiberSection.layer):
        j = j + i 
        item.material.matTag = 2*(j+1)
        item.material.matTagMinMax = 2*j+1
        #print(j+i)
    w = j+2
    for i, item in enumerate(FiberSection.fiber):
        w = w + i 
        item.material.matTag = 2*(w+1)
        item.material.matTagMinMax = 2*w+1
        
    MC = MomentCurvature(FiberSection, P, alpha, maxPhi, nIncr)

script = MC.write_tcl()
#print(script)

outputFileName = 'openSeesSectionModel'
recorderFileName1 = 'MKsectionForce.out'
recorderFileName2 = 'MKsectionDef.out'

if checkData:
    FolderPath = rs.DocumentPath()
    os.chdir(FolderPath)

    
for dirpath, dirnames, filenames in os.walk(FolderPath):
    for filename in filenames:
        if filename == outputFileName:
            file = os.path.join(dirpath,outputFileName)
            filepath1 = os.path.join(dirpath,recorderFileName1)
            filepath2 = os.path.join(dirpath,recorderFileName2)
        elif filename == recorderFileName1:
            file1 = os.path.join(dirpath,recorderFileName1)
            file2 = os.path.join(dirpath,recorderFileName2)
            os.remove(file1)
            os.remove(file2)

time_start = time.clock()

with open(outputFileName, 'w') as f:
    for line in MC.write_tcl():
        f.write(line)
    f.close()

time_elapsed = (time.clock() - time_start)
#print("Writing Time {}".format(time_elapsed))


time_start = time.clock()

executable = os.path.join(ghcompfolder,'Alpaca4d\OpenSees-Solvers\opensees.bat')

#process = subprocess.Popen([r'C:\OpenSees\bin\OpenSees', outputFileName], shell = True, stdout=subprocess.PIPE, stderr=subprocess.PIPE)
process = subprocess.Popen([executable, outputFileName], shell = True,  stdout=subprocess.PIPE, stderr=subprocess.PIPE)
stdout, stderr = process.communicate()
print(stdout, stderr)
process.kill()

time_elapsed = (time.clock() - time_start)
print("Analyses Time {}".format(time_elapsed))




fileObj = open(filepath1, 'r')
words = fileObj.read().splitlines(" ")
#N = [ float(i.split()[0]) for i in words]
M1 = [ float(i.split()[1]) for i in words]
M2 = [ float(i.split()[2]) for i in words]
#M3 = [ float(i.split()[3]) for i in words]
fileObj.close()
#FiberSection = [k, M]

fileObj = open(filepath2, 'r')
words = fileObj.read().splitlines(" ")
#N = [ float(i.split()[0]) for i in words]
k1 = [ float(i.split()[1]) for i in words]
k2 = [ float(i.split()[2]) for i in words]
#k3 = [ float(i.split()[3]) for i in words]
fileObj.close()
# ---------- end mcm ----------
dm1m2 = DomainM1M2Alpaca4d()  # -> out, N, M1, M2; inputs nPoint: Int32
# ---------- dm1m2: Python ----------
"""
Run an OpenSees Analysis
-
    Args:
        FiberSection:
        direction: 1 for M2 and 2 for M1. Default is 1 
        nPoint: number of Point for make de N-M domain
    Returns:
        N: axial load valor
        M: bending moment valor
"""



import Rhino.RhinoDoc
import Grasshopper as gh
import copy
import rhinoscriptsyntax as rs
import Rhino.Geometry as rg
import os
import time
import sys
import subprocess
import ghpythonlib.treehelpers as th
import math as mt
import ghpythonlib.parallel as ghp



ghenv.Component.Name = "Domain M1 M2 (Alpaca4d)"
ghenv.Component.NickName = 'DM1M2'
ghenv.Component.Message = "Domain M1 M2 (Alpaca4d)"

ghcompfolder = gh.Folders.DefaultAssemblyFolder
if ghcompfolder not in sys.path:
    sys.path.append(ghcompfolder)

try:
    from Alpaca4d import alpaca4d as alpaca
except:
    msg = "Cannot import Alpaca4d. Is the Alpaca4d folder available in " + ghcompfolder + "?"
    ghenv.Component.AddRuntimeMessage(gh.Kernel.GH_RuntimeMessageLevel.Error, msg)


checkData = True



if not FiberSection:
    checkData = False
    msg = "Input parameter AlpacaModel failed to collect data"
    ghenv.Component.AddRuntimeMessage(gh.Kernel.GH_RuntimeMessageLevel.Warning, msg)


"""
class MomentCurvature(object):
    def __init__(self, recorderName, section, axialLoad, valorMfix, direction, maxPhi, cForce, numIncr=100):
        #^ y
        #|
        #|
        #|------> x
        self.recorderName = recorderName
        self.section = section
        self.axialLoad = axialLoad
        self.valorMfix = valorMfix
        self.direction = direction
        self.maxPhi = maxPhi
        self.cForce = cForce
        self.numIncr= numIncr
        # Compute curvature increment
        #self.dK = self.maxK / self.numIncr
        self.secTag = 1
        

    def ToString(self):
        return self.write_tcl()

    def write_tcl(self):
        # Define two nodes at (0,0)
        clean = "wipe\n"
        model = "model BasicBuilder -ndm 3 -ndf 6\n"
        
        materialFiber = ''.join([ i.material.write_tcl() for i in self.section.fiber ])
        materialPath = ''.join([ i.material.write_tcl() for i in self.section.path ])
        materialLayer = ''.join([ i.material.write_tcl() for i in self.section.layer ])
        material = materialFiber + materialPath + materialLayer
        
        section = self.section.ToString()
        node1 = "node {} {} {} {}\n".format(1, self.cForce.X, self.cForce.Y, self.cForce.Z)
        node2 = "node {} {} {} {}\n".format(2, self.cForce.X, self.cForce.Y, self.cForce.Z)
        # Fix all degrees of freedom except axial and bending
        fix1 = "fix {} {} {} {} {} {} {}\n".format(1, 1, 1, 1, 1 ,1, 1) #node tag Fx Fy Fz Mx My Mz
        fix2 = "fix {} {} {} {} {} {} {}\n".format(2, 0, 1, 1, 1, 0, 0) #node tag Fx Fy Fz Mx My Mz
        # Define element
        ele = "element zeroLengthSection {} {} {} {}\n".format( 1, 1, 2, self.secTag) #-orient 1 0 0 1 0 0
        # Define constant axial load
        pattern = 'pattern Plain {} "{}" {}\n'.format( 1, 'Constant', "{;")   
        load = "load {} {} {} {} {} {} {};\n".format(2, self.axialLoad, 0.0, 0.0, 0.0, 0.0, 0.0) +  "}\n" 
        # analysis for constant axial load
        Integrator = "integrator LoadControl {}\n".format( 0.1)
        System = "system BandGeneral\n" #-piv
        Test = "test NormUnbalance {} {}\n".format( 1e-10, 1000)
        number = "numberer RCM\n"
        constraints = "constraints Plain\n"
        algorithm = "algorithm Newton\n"
        analysis = "analysis Static\n"
        # Do one analysis for constant axial load
        analyze = "analyze {}\n".format(10) 
        lC = "loadConst -time 0.0\n"
        # Define reference moment 
        recorderName1 = self.recorderName + "Force" + ".out"
        recorderName2 = self.recorderName + "Disp" + ".out"
        recorder1 = "recorder Element -file {} -ele 1 section force\n".format(recorderName1)
        #recorder2 = "recorder Element -file {} -ele 1 section deformation\n".format(recorderName2)
        patternM = 'pattern Plain {} "{}" {}\n'.format( 2, 'Linear', "{;")   
        # Use displacement control at node 2 for section analysis
        #IntegratorD = "integrator DisplacementControl {} {} {} {} {} {}\n".format(2,3,0.00035,1,self.dK,self.dK)
        if self.direction == 1 and self.maxPhi >0:
            directionID = 5
            loadM = "load {} {} {} {} {} {} {};\n".format(2, 0.0, 0.0, 0.0, 0.0, self.direction, self.valorMfix) +  "}\n"
            
        elif self.direction == 2 and self.maxPhi >0:
            directionID = 6
            loadM = "load {} {} {} {} {} {} {};\n".format(2, 0.0, 0.0, 0.0, 0.0, self.valorMfix, self.direction) +  "}\n" 
            
        elif self.direction == 1 and self.maxPhi <0:
            directionID = 5
            loadM = "load {} {} {} {} {} {} {};\n".format(2, 0.0, 0.0, 0.0, 0.0, -self.direction, self.valorMfix) +  "}\n" 
            
        elif self.direction == 2 and self.maxPhi <0:
            directionID = 6
            loadM = "load {} {} {} {} {} {} {};\n".format(2, 0.0, 0.0, 0.0, 0.0, self.valorMfix, -self.direction) +  "}\n" 
            
        IntegratorD = "integrator DisplacementControl {} {} {} {}\n".format(2,directionID,self.maxPhi/self.numIncr, 100) #node dof incr numIter
        #IntegratorD = 'integrator ' + self.Integrator.ToString() + "\n"
        analyze2 = "analyze {}\n".format(self.numIncr) + "\n" + "wipe"+ "\n"

        analyze2 = "set ok [analyze {}]\n".format(self.numIncr) #+ "\n" + "wipe"+ "\n"
        A = "set IDctrlNode 2\n" 
        B = "set IDctrlDOF 6\n"
        C = "set Dmax {}\n".format(self.maxPhi)
        D = "set Dincr {}\n".format(self.maxPhi/self.numIncr)
        E = "set TolStatic {}\n".format(1.e-9)
        F = "set testTypeStatic EnergyIncr \n"
        G = "set maxNumIterStatic {}\n".format(11)
        H = "set algorithmTypeStatic Newton\n"
        #source = "wipe\n"
        source = "source C:/Users/Domen/Desktop/Alpaca MC/aaa.txt\n"

        #return clean + model + material + section +  node1 + node2 + fix1 + fix2 + ele + pattern + load + Integrator + System + Test + number + constraints + algorithm + analysis + analyze +lC + recorder1 + patternM + loadM + IntegratorD + analyze2 + A + B + C + D + E + F + G + H + source
        return clean + model + material + section +  node1 + node2 + fix1 + fix2 + ele + pattern + load + Integrator + System + Test + number + constraints + algorithm + analysis + analyze +lC + recorder1 + patternM + loadM + IntegratorD + analyze2


    def write_py(self):
        # Define two nodes at (0,0)


        return node1 + node2 + fix1 + fix2 + ele  + timeSeries + pattern + load + Integrator + System + test + number + constraints + algorithm + analysis + analyze + timeSeriesM + patternM + loadM + IntegratorD + analyze2
"""
def linspace(start, stop, len):
    step = (mt.fabs(start)+stop)/(len-1)
    return [start + step*interval for interval in range(len)]
    
class MomentCurvature(object):
    def __init__(self, recorderName, section, axialLoad, alpha, maxPhi, numIncr=100):
        #^ y
        #|
        #|
        #|------> x
        self.recorderName = recorderName
        self.section = section
        self.axialLoad = axialLoad
        self.alpha = mt.radians(alpha)
        self.maxPhi = maxPhi
        self.numIncr= numIncr
        # Compute curvature increment
        #self.dK = self.maxK / self.numIncr
        self.secTag = 1
        

    def ToString(self):
        return self.write_tcl()

    def write_tcl(self):
        # Define two nodes at (0,0)
        clean = "wipe\n"
        model = "model BasicBuilder -ndm 3 -ndf 6\n"
        
        materialFiber = ''.join([ i.material.write_tcl() for i in self.section.fiber ])
        materialPath = ''.join([ i.material.write_tcl() for i in self.section.path ])
        materialLayer = ''.join([ i.material.write_tcl() for i in self.section.layer ])
        material = materialFiber + materialPath + materialLayer
        
        section = self.section.ToString()
        node1 = "node {} {} {} {}\n".format(1, self.section.centerSection.X, self.section.centerSection.Y, self.section.centerSection.Z)
        node2 = "node {} {} {} {}\n".format(2, self.section.centerSection.X, self.section.centerSection.Y, self.section.centerSection.Z)
        # Fix all degrees of freedom except axial and bending
        fix1 = "fix {} {} {} {} {} {} {}\n".format(1, 1, 1, 1, 1 ,1, 1) #node tag Fx Fy Fz Mx My Mz
        fix2 = "fix {} {} {} {} {} {} {}\n".format(2, 0, 1, 1, 1, 0, 0) #node tag Fx Fy Fz Mx My Mz
        # Define element
        ele = "element zeroLengthSection {} {} {} {} -orient 1 0 0 0 {} {}\n".format( 1, 1, 2, self.secTag, mt.cos(self.alpha), mt.sin(self.alpha)) #-orient 1 0 0 0 $cos $sin
        # Define constant axial load
        pattern = 'pattern Plain {} "{}" {}\n'.format( 1, 'Constant', "{;")   
        load = "load {} {} {} {} {} {} {};\n".format(2, self.axialLoad, 0.0, 0.0, 0.0, 0.0, 0.0) +  "}\n" 
        # analysis for constant axial load
        Integrator = "integrator LoadControl {}\n".format( 0.1)
        System = "system BandGeneral\n" #-piv
        Test = "test NormUnbalance {} {}\n".format( 1e-10, 1000)
        number = "numberer RCM\n"
        constraints = "constraints Plain\n"
        algorithm = "algorithm Newton\n"
        analysis = "analysis Static\n"
        # Do one analysis for constant axial load
        analyze = "analyze {}\n".format(10) 
        lC = "loadConst -time 0.0\n"
        # Define reference moment 
        recorderName1 = self.recorderName + "Force" + ".out"
        recorderName2 = self.recorderName + "Disp" + ".out"
        recorder1 = "recorder Element -file {} -ele 1 section force\n".format(recorderName1)
        #recorder2 = "recorder Element -file {} -ele 1 section deformation\n".format(recorderName2)
        patternM = 'pattern Plain {} "{}" {}\n'.format( 2, 'Linear', "{;")   
        # Use displacement control at node 2 for section analysis
        loadM = "load {} {} {} {} {} {} {};\n".format(2, 0.0, 0.0, 0.0, 0.0, 1.0, 0.0) +  "}\n" 
        IntegratorD = "integrator DisplacementControl {} {} {}\n".format(2, 5, self.maxPhi/self.numIncr)
        #IntegratorD = 'integrator ' + self.Integrator.ToString() + "\n"
        analyze2 = "analyze {}\n".format(self.numIncr) + "\n" + "wipe"+ "\n"

        return clean + model + material + section +  node1 + node2 + fix1 + fix2 + ele + pattern + load + Integrator + System + Test + number + constraints + algorithm + analysis + analyze +lC + recorder1 + patternM + loadM + IntegratorD + analyze2


def RunMCpositive(Pi): 
    if Pi > 0.0:
        recorderFileName = "MKsectionP{}positiveMpositive".format(int(mt.fabs(Pi)))
        outputFileName = "OSSModel{}positiveMpositive".format(int(mt.fabs(Pi)))
    elif Pi < 0.0:
        recorderFileName = "MKsectionP{}negativeMpositive".format(int(mt.fabs(Pi)))
        outputFileName = "OSSModel{}negativeMpositive".format(int(mt.fabs(Pi)))
    
    if nPoint == None:
        alpha = linspace(0,360, 36)
    else :
        alpha = linspace(0,360, nPoint)
   
        
    listN = []
    listM1 = []
    listM2 = []
    for alphai in alpha:
        MC = MomentCurvature(recorderFileName,FiberSection, float(Pi), alphai, 2.0, 1000) #mu*FiberSection.Ky
        script = MC.write_tcl()
    
        FolderPath = rs.DocumentPath()
        os.chdir(FolderPath)
        
        recorderFileName1 = recorderFileName + "Force" + ".out"
        recorderFileName2 = recorderFileName + "Disp" + ".out"
    
        runFileName = os.path.join(FolderPath,outputFileName)
        filepath1 = os.path.join(FolderPath,recorderFileName1)
        #filepath2 = os.path.join(FolderPath,recorderFileName2)
        time_start = time.clock()
    
        with open(outputFileName, 'w') as f:
            for line in MC.write_tcl():
                f.write(line)
            f.close()
    
        time_elapsed = (time.clock() - time_start)
        #print("Writing Time {}".format(time_elapsed))
        
        time_start = time.clock()
        
        executable = os.path.join(ghcompfolder,'Alpaca4d\OpenSees-Solvers\opensees.bat')
        #executable = os.path.join(ghcompfolder,'C:\OpenSees\bin\opensees.bat')
        
        #process = subprocess.Popen([r'C:\OpenSees\bin\OpenSees', outputFileName], shell = True, stdout=subprocess.PIPE, stderr=subprocess.PIPE)
        process = subprocess.Popen([executable, outputFileName], shell = True,  stdout=subprocess.PIPE, stderr=subprocess.PIPE)
        stdout, stderr = process.communicate()
        #print(stdout, stderr)
        process.kill()
        os.remove(runFileName)
        time_elapsed = (time.clock() - time_start)
        #print("Analyses Time {}".format(time_elapsed))
        #filepath = os.path.join(r'C:\OpenSees\bin',recorderFileName)
        fileObj = open(filepath1, 'r')
        words = fileObj.read().splitlines(" ")
        #print(fileObj.read())
        N = "None"
        if len(words) != 0:
            N = float(words[-1].split()[0])
            M1 = float(words[-1].split()[1])
            M2 = float(words[-1].split()[2])
            
            listN.append(N)
            listM1.append(M1)
            listM2.append(M2)
        fileObj.close()

        os.remove(filepath1)
    """
    fileObj = open(filepath2, 'r')
    words = fileObj.read().splitlines(" ")
    #print(fileObj.read())

    k1 = [ float(i.split()[1]) for i in words]
    k2 = [ float(i.split()[2]) for i in words]
    k3 = [ float(i.split()[3]) for i in words]
    fileObj.close()
    """
        #os.remove(filepath2)
    if N != "None" :
        return [listN, listM1, listM2]


        
        

        
if checkData:
    FiberSection.secTag = 1
    for i, item in enumerate(FiberSection.path):
        item.material.matTag = 2*(i+1)
        item.material.matTagMinMax = 2*i+1
        #print(item.material.matTag )
    j = i+2
    for i, item in enumerate(FiberSection.layer):
        j = j + i 
        item.material.matTag = 2*(j+1)
        item.material.matTagMinMax = 2*j+1
        #print(j+i)
    w = j+2
    for i, item in enumerate(FiberSection.fiber):
        w = w + i 
        item.material.matTag = 2*(w+1)
        item.material.matTagMinMax = 2*w+1
        
#A = ghp.run(RunNEps,[-1.0, 1.0], True)



    
print(FiberSection.NultNeg+0.1*FiberSection.NultNeg,FiberSection.NultPos)


#n1 = int(mt.fabs(min(A)/stepValorPositive))
#n2 = int(mt.fabs(max(A)/stepValorNegative))

#listP = linspace(min(A), -5.0, n1) + linspace(5, max(A)-10.0, n2)


if axialLoad == None:
    axialLoad = 0.1
B = ghp.run(RunMCpositive, [axialLoad],False)
B =filter(None, B)
#C = ghp.run(RunMCnegative, listP,False)

#print(B[1])
#RunM1Cpositive(Pi): 

N, M1, M2 = [], [], []

for item in B:
    #item =filter(None, item) #elimino il None
    N.append(item[0])
    M1.append(item[1])
    M2.append(item[2])


N, M1, M2 = th.list_to_tree(N), th.list_to_tree(M1), th.list_to_tree(M2)



"""
for item in B:
    Nupos.append(item[0])
    M1uP.append( item[1])
    M2uP.append( item[2])
    #M3uP.append( item[3])
    
for item in C:
    Nuneg.append(item[0])
    M1uN.append( item[1])
    M2uN.append( item[2])

M1 = M1uN + M1uP[::-1] + M1uN[0:1]
M2 = M2uN + M2uP[::-1] + M2uN[0:1]
N = Nuneg + Nupos[::-1] + Nuneg[0:1]

if direction == 1:
    M = M2
else:
    M = M1
"""
# ---------- end dm1m2 ----------
_3dd = _3DDomainAlpaca4d()  # -> out, N, M1, M2; inputs nPoint: Int32
# ---------- _3dd: Python ----------
"""
Run an OpenSees Analysis
-
    Args:
        FiberSection:
        direction: 1 for M2 and 2 for M1. Default is 1 
        nPoint: number of Point for make de N-M domain
    Returns:
        N: axial load valor
        M: bending moment valor
"""



import Rhino.RhinoDoc
import Grasshopper as gh
import copy
import rhinoscriptsyntax as rs
import Rhino.Geometry as rg
import os
import time
import sys
import subprocess
import ghpythonlib.treehelpers as th
import math as mt
import ghpythonlib.parallel as ghp



ghenv.Component.Name = "3D Domain (Alpaca4d)"
ghenv.Component.NickName = '3DD'
ghenv.Component.Message = "3D Domain (Alpaca4d)"

ghcompfolder = gh.Folders.DefaultAssemblyFolder
if ghcompfolder not in sys.path:
    sys.path.append(ghcompfolder)

try:
    from Alpaca4d import alpaca4d as alpaca
except:
    msg = "Cannot import Alpaca4d. Is the Alpaca4d folder available in " + ghcompfolder + "?"
    ghenv.Component.AddRuntimeMessage(gh.Kernel.GH_RuntimeMessageLevel.Error, msg)


checkData = True



if not FiberSection:
    checkData = False
    msg = "Input parameter AlpacaModel failed to collect data"
    ghenv.Component.AddRuntimeMessage(gh.Kernel.GH_RuntimeMessageLevel.Warning, msg)


"""
class MomentCurvature(object):
    def __init__(self, recorderName, section, axialLoad, valorMfix, direction, maxPhi, cForce, numIncr=100):
        #^ y
        #|
        #|
        #|------> x
        self.recorderName = recorderName
        self.section = section
        self.axialLoad = axialLoad
        self.valorMfix = valorMfix
        self.direction = direction
        self.maxPhi = maxPhi
        self.cForce = cForce
        self.numIncr= numIncr
        # Compute curvature increment
        #self.dK = self.maxK / self.numIncr
        self.secTag = 1
        

    def ToString(self):
        return self.write_tcl()

    def write_tcl(self):
        # Define two nodes at (0,0)
        clean = "wipe\n"
        model = "model BasicBuilder -ndm 3 -ndf 6\n"
        
        materialFiber = ''.join([ i.material.write_tcl() for i in self.section.fiber ])
        materialPath = ''.join([ i.material.write_tcl() for i in self.section.path ])
        materialLayer = ''.join([ i.material.write_tcl() for i in self.section.layer ])
        material = materialFiber + materialPath + materialLayer
        
        section = self.section.ToString()
        node1 = "node {} {} {} {}\n".format(1, self.cForce.X, self.cForce.Y, self.cForce.Z)
        node2 = "node {} {} {} {}\n".format(2, self.cForce.X, self.cForce.Y, self.cForce.Z)
        # Fix all degrees of freedom except axial and bending
        fix1 = "fix {} {} {} {} {} {} {}\n".format(1, 1, 1, 1, 1 ,1, 1) #node tag Fx Fy Fz Mx My Mz
        fix2 = "fix {} {} {} {} {} {} {}\n".format(2, 0, 1, 1, 1, 0, 0) #node tag Fx Fy Fz Mx My Mz
        # Define element
        ele = "element zeroLengthSection {} {} {} {}\n".format( 1, 1, 2, self.secTag) #-orient 1 0 0 1 0 0
        # Define constant axial load
        pattern = 'pattern Plain {} "{}" {}\n'.format( 1, 'Constant', "{;")   
        load = "load {} {} {} {} {} {} {};\n".format(2, self.axialLoad, 0.0, 0.0, 0.0, 0.0, 0.0) +  "}\n" 
        # analysis for constant axial load
        Integrator = "integrator LoadControl {}\n".format( 0.1)
        System = "system BandGeneral\n" #-piv
        Test = "test NormUnbalance {} {}\n".format( 1e-10, 1000)
        number = "numberer RCM\n"
        constraints = "constraints Plain\n"
        algorithm = "algorithm Newton\n"
        analysis = "analysis Static\n"
        # Do one analysis for constant axial load
        analyze = "analyze {}\n".format(10) 
        lC = "loadConst -time 0.0\n"
        # Define reference moment 
        recorderName1 = self.recorderName + "Force" + ".out"
        recorderName2 = self.recorderName + "Disp" + ".out"
        recorder1 = "recorder Element -file {} -ele 1 section force\n".format(recorderName1)
        #recorder2 = "recorder Element -file {} -ele 1 section deformation\n".format(recorderName2)
        patternM = 'pattern Plain {} "{}" {}\n'.format( 2, 'Linear', "{;")   
        # Use displacement control at node 2 for section analysis
        #IntegratorD = "integrator DisplacementControl {} {} {} {} {} {}\n".format(2,3,0.00035,1,self.dK,self.dK)
        if self.direction == 1 and self.maxPhi >0:
            directionID = 5
            loadM = "load {} {} {} {} {} {} {};\n".format(2, 0.0, 0.0, 0.0, 0.0, self.direction, self.valorMfix) +  "}\n"
            
        elif self.direction == 2 and self.maxPhi >0:
            directionID = 6
            loadM = "load {} {} {} {} {} {} {};\n".format(2, 0.0, 0.0, 0.0, 0.0, self.valorMfix, self.direction) +  "}\n" 
            
        elif self.direction == 1 and self.maxPhi <0:
            directionID = 5
            loadM = "load {} {} {} {} {} {} {};\n".format(2, 0.0, 0.0, 0.0, 0.0, -self.direction, self.valorMfix) +  "}\n" 
            
        elif self.direction == 2 and self.maxPhi <0:
            directionID = 6
            loadM = "load {} {} {} {} {} {} {};\n".format(2, 0.0, 0.0, 0.0, 0.0, self.valorMfix, -self.direction) +  "}\n" 
            
        IntegratorD = "integrator DisplacementControl {} {} {} {}\n".format(2,directionID,self.maxPhi/self.numIncr, 100) #node dof incr numIter
        #IntegratorD = 'integrator ' + self.Integrator.ToString() + "\n"
        analyze2 = "analyze {}\n".format(self.numIncr) + "\n" + "wipe"+ "\n"

        analyze2 = "set ok [analyze {}]\n".format(self.numIncr) #+ "\n" + "wipe"+ "\n"
        A = "set IDctrlNode 2\n" 
        B = "set IDctrlDOF 6\n"
        C = "set Dmax {}\n".format(self.maxPhi)
        D = "set Dincr {}\n".format(self.maxPhi/self.numIncr)
        E = "set TolStatic {}\n".format(1.e-9)
        F = "set testTypeStatic EnergyIncr \n"
        G = "set maxNumIterStatic {}\n".format(11)
        H = "set algorithmTypeStatic Newton\n"
        #source = "wipe\n"
        source = "source C:/Users/Domen/Desktop/Alpaca MC/aaa.txt\n"

        #return clean + model + material + section +  node1 + node2 + fix1 + fix2 + ele + pattern + load + Integrator + System + Test + number + constraints + algorithm + analysis + analyze +lC + recorder1 + patternM + loadM + IntegratorD + analyze2 + A + B + C + D + E + F + G + H + source
        return clean + model + material + section +  node1 + node2 + fix1 + fix2 + ele + pattern + load + Integrator + System + Test + number + constraints + algorithm + analysis + analyze +lC + recorder1 + patternM + loadM + IntegratorD + analyze2


    def write_py(self):
        # Define two nodes at (0,0)


        return node1 + node2 + fix1 + fix2 + ele  + timeSeries + pattern + load + Integrator + System + test + number + constraints + algorithm + analysis + analyze + timeSeriesM + patternM + loadM + IntegratorD + analyze2
"""
def linspace(start, stop, len):
    step = (mt.fabs(start)+stop)/(len-1)
    return [start + step*interval for interval in range(len)]
    
class MomentCurvature(object):
    def __init__(self, recorderName, section, axialLoad, alpha, maxPhi, numIncr=100):
        #^ y
        #|
        #|
        #|------> x
        self.recorderName = recorderName
        self.section = section
        self.axialLoad = axialLoad
        self.alpha = mt.radians(alpha)
        self.maxPhi = maxPhi
        self.numIncr= numIncr
        # Compute curvature increment
        #self.dK = self.maxK / self.numIncr
        self.secTag = 1
        

    def ToString(self):
        return self.write_tcl()

    def write_tcl(self):
        # Define two nodes at (0,0)
        clean = "wipe\n"
        model = "model BasicBuilder -ndm 3 -ndf 6\n"
        
        materialFiber = ''.join([ i.material.write_tcl() for i in self.section.fiber ])
        materialPath = ''.join([ i.material.write_tcl() for i in self.section.path ])
        materialLayer = ''.join([ i.material.write_tcl() for i in self.section.layer ])
        material = materialFiber + materialPath + materialLayer
        
        section = self.section.ToString()
        node1 = "node {} {} {} {}\n".format(1, self.section.centerSection.X, self.section.centerSection.Y, self.section.centerSection.Z)
        node2 = "node {} {} {} {}\n".format(2, self.section.centerSection.X, self.section.centerSection.Y, self.section.centerSection.Z)
        # Fix all degrees of freedom except axial and bending
        fix1 = "fix {} {} {} {} {} {} {}\n".format(1, 1, 1, 1, 1 ,1, 1) #node tag Fx Fy Fz Mx My Mz
        fix2 = "fix {} {} {} {} {} {} {}\n".format(2, 0, 1, 1, 1, 0, 0) #node tag Fx Fy Fz Mx My Mz
        # Define element
        ele = "element zeroLengthSection {} {} {} {} -orient 1 0 0 0 {} {}\n".format( 1, 1, 2, self.secTag, mt.cos(self.alpha), mt.sin(self.alpha)) #-orient 1 0 0 0 $cos $sin
        # Define constant axial load
        pattern = 'pattern Plain {} "{}" {}\n'.format( 1, 'Constant', "{;")   
        load = "load {} {} {} {} {} {} {};\n".format(2, self.axialLoad, 0.0, 0.0, 0.0, 0.0, 0.0) +  "}\n" 
        # analysis for constant axial load
        Integrator = "integrator LoadControl {}\n".format( 0.1)
        System = "system BandGeneral\n" #-piv
        Test = "test NormUnbalance {} {}\n".format( 1e-10, 1000)
        number = "numberer RCM\n"
        constraints = "constraints Plain\n"
        algorithm = "algorithm Newton\n"
        analysis = "analysis Static\n"
        # Do one analysis for constant axial load
        analyze = "analyze {}\n".format(10) 
        lC = "loadConst -time 0.0\n"
        # Define reference moment 
        recorderName1 = self.recorderName + "Force" + ".out"
        recorderName2 = self.recorderName + "Disp" + ".out"
        recorder1 = "recorder Element -file {} -ele 1 section force\n".format(recorderName1)
        #recorder2 = "recorder Element -file {} -ele 1 section deformation\n".format(recorderName2)
        patternM = 'pattern Plain {} "{}" {}\n'.format( 2, 'Linear', "{;")   
        # Use displacement control at node 2 for section analysis
        loadM = "load {} {} {} {} {} {} {};\n".format(2, 0.0, 0.0, 0.0, 0.0, 1.0, 0.0) +  "}\n" 
        IntegratorD = "integrator DisplacementControl {} {} {}\n".format(2, 5, self.maxPhi/self.numIncr)
        #IntegratorD = 'integrator ' + self.Integrator.ToString() + "\n"
        analyze2 = "analyze {}\n".format(self.numIncr) + "\n" + "wipe"+ "\n"

        return clean + model + material + section +  node1 + node2 + fix1 + fix2 + ele + pattern + load + Integrator + System + Test + number + constraints + algorithm + analysis + analyze +lC + recorder1 + patternM + loadM + IntegratorD + analyze2


def RunMCpositive(Pi): 
    if Pi > 0.0:
        recorderFileName = "MKsectionP{}positiveMpositive".format(int(mt.fabs(Pi)))
        outputFileName = "OSSModel{}positiveMpositive".format(int(mt.fabs(Pi)))
    elif Pi < 0.0:
        recorderFileName = "MKsectionP{}negativeMpositive".format(int(mt.fabs(Pi)))
        outputFileName = "OSSModel{}negativeMpositive".format(int(mt.fabs(Pi)))
        
    alpha = linspace(0,360, 36)
    
    
    listN = []
    listM1 = []
    listM2 = []
    for alphai in alpha:
        MC = MomentCurvature(recorderFileName,FiberSection, float(Pi), alphai, 2.0, 1000) #mu*FiberSection.Ky
        script = MC.write_tcl()
    
        FolderPath = rs.DocumentPath()
        os.chdir(FolderPath)
        
        recorderFileName1 = recorderFileName + "Force" + ".out"
        recorderFileName2 = recorderFileName + "Disp" + ".out"
    
        runFileName = os.path.join(FolderPath,outputFileName)
        filepath1 = os.path.join(FolderPath,recorderFileName1)
        #filepath2 = os.path.join(FolderPath,recorderFileName2)
        time_start = time.clock()
    
        with open(outputFileName, 'w') as f:
            for line in MC.write_tcl():
                f.write(line)
            f.close()
    
        time_elapsed = (time.clock() - time_start)
        #print("Writing Time {}".format(time_elapsed))
        
        time_start = time.clock()
        
        executable = os.path.join(ghcompfolder,'Alpaca4d\OpenSees-Solvers\opensees.bat')
        #executable = os.path.join(ghcompfolder,'C:\OpenSees\bin\opensees.bat')
        
        #process = subprocess.Popen([r'C:\OpenSees\bin\OpenSees', outputFileName], shell = True, stdout=subprocess.PIPE, stderr=subprocess.PIPE)
        process = subprocess.Popen([executable, outputFileName], shell = True,  stdout=subprocess.PIPE, stderr=subprocess.PIPE)
        stdout, stderr = process.communicate()
        #print(stdout, stderr)
        process.kill()
        os.remove(runFileName)
        time_elapsed = (time.clock() - time_start)
        #print("Analyses Time {}".format(time_elapsed))
        #filepath = os.path.join(r'C:\OpenSees\bin',recorderFileName)
        fileObj = open(filepath1, 'r')
        words = fileObj.read().splitlines(" ")
        #print(fileObj.read())
        N = "None"
        if len(words) != 0:
            N = float(words[-1].split()[0])
            M1 = float(words[-1].split()[1])
            M2 = float(words[-1].split()[2])
            
            listN.append(N)
            listM1.append(M1)
            listM2.append(M2)
        fileObj.close()

        os.remove(filepath1)
    """
    fileObj = open(filepath2, 'r')
    words = fileObj.read().splitlines(" ")
    #print(fileObj.read())

    k1 = [ float(i.split()[1]) for i in words]
    k2 = [ float(i.split()[2]) for i in words]
    k3 = [ float(i.split()[3]) for i in words]
    fileObj.close()
    """
        #os.remove(filepath2)
    if N != "None" :
        return [listN, listM1, listM2]


        
        

        
if checkData:
    FiberSection.secTag = 1
    for i, item in enumerate(FiberSection.path):
        item.material.matTag = 2*(i+1)
        item.material.matTagMinMax = 2*i+1
        #print(item.material.matTag )
    j = i+2
    for i, item in enumerate(FiberSection.layer):
        j = j + i 
        item.material.matTag = 2*(j+1)
        item.material.matTagMinMax = 2*j+1
        #print(j+i)
    w = j+2
    for i, item in enumerate(FiberSection.fiber):
        w = w + i 
        item.material.matTag = 2*(w+1)
        item.material.matTagMinMax = 2*w+1
        
#A = ghp.run(RunNEps,[-1.0, 1.0], True)



    
print(FiberSection.NultNeg+0.1*FiberSection.NultNeg,FiberSection.NultPos)


#n1 = int(mt.fabs(min(A)/stepValorPositive))
#n2 = int(mt.fabs(max(A)/stepValorNegative))

#listP = linspace(min(A), -5.0, n1) + linspace(5, max(A)-10.0, n2)


    
listP = linspace(FiberSection.NultNeg,FiberSection.NultPos, nPoint)


B = ghp.run(RunMCpositive, listP,False)
B =filter(None, B)
#C = ghp.run(RunMCnegative, listP,False)

#print(B[1])
#RunM1Cpositive(Pi): 

N, M1, M2 = [], [], []

for item in B:
    #item =filter(None, item) #elimino il None
    N.append(item[0])
    M1.append(item[1])
    M2.append(item[2])


N, M1, M2 = th.list_to_tree(N), th.list_to_tree(M1), th.list_to_tree(M2)



"""
for item in B:
    Nupos.append(item[0])
    M1uP.append( item[1])
    M2uP.append( item[2])
    #M3uP.append( item[3])
    
for item in C:
    Nuneg.append(item[0])
    M1uN.append( item[1])
    M2uN.append( item[2])

M1 = M1uN + M1uP[::-1] + M1uN[0:1]
M2 = M2uN + M2uP[::-1] + M2uN[0:1]
N = Nuneg + Nupos[::-1] + Nuneg[0:1]

if direction == 1:
    M = M2
else:
    M = M1
"""
# ---------- end _3dd ----------
# Domain Axial force - Bending moment  solver
number_slider_6 = Slider(2, range=0..10)

# ---- group: 3D
number_slider_7 = Slider(1, range=0..10)
number_slider_8 = Slider(1000, range=0..10000)
number_slider_9 = Slider(0.5, range=0..1)
neg_4 = Negative(Value=Slider(100, range=0..1000))
# Bending Moment - curvature  solver
mcm_2 = MomentCurvatureModelAlpaca4d()  # -> out, script, k1, k2, k3, M1, M2, M3; inputs direction: Int32, nIncr: Int32
# ---------- mcm_2: Python ----------
"""
Run an OpenSees Analysis
-
    Args:
        FiberSection:
        P: axial load 
        mu: Target ductility for analysis
        nIncr: Number of analysis increments
    Returns:
        AlpacaSolvedModel:
"""



import Rhino.RhinoDoc
import Grasshopper as gh
import copy
import rhinoscriptsyntax as rs
import Rhino.Geometry as rg
import os
import time
import sys
import subprocess



ghenv.Component.Name = "Moment Curvature Model (Alpaca4d)"
ghenv.Component.NickName = 'MCM'
ghenv.Component.Message = "Moment Curvature Model (Alpaca4d)"

ghcompfolder = gh.Folders.DefaultAssemblyFolder
if ghcompfolder not in sys.path:
    sys.path.append(ghcompfolder)

try:
    from Alpaca4d import alpaca4d as alpaca
except:
    msg = "Cannot import Alpaca4d. Is the Alpaca4d folder available in " + ghcompfolder + "?"
    ghenv.Component.AddRuntimeMessage(gh.Kernel.GH_RuntimeMessageLevel.Error, msg)


checkData = True



if not FiberSection:
    checkData = False
    msg = "Input parameter AlpacaModel failed to collect data"
    ghenv.Component.AddRuntimeMessage(gh.Kernel.GH_RuntimeMessageLevel.Warning, msg)
if not P: #
    checkData = False
    msg = "Input parameter P failed to collect data"
    ghenv.Component.AddRuntimeMessage(gh.Kernel.GH_RuntimeMessageLevel.Warning, msg)
    
if not direction: #
    checkData = False
    msg = "Input parameter direction failed to collect data"
    ghenv.Component.AddRuntimeMessage(gh.Kernel.GH_RuntimeMessageLevel.Warning, msg)

if not maxPhi: #
    checkData = False
    msg = "Input parameter maxPhi failed to collect data"
    ghenv.Component.AddRuntimeMessage(gh.Kernel.GH_RuntimeMessageLevel.Warning, msg)

if not nIncr: #
    checkData = False
    msg = "Input parameter nIncr failed to collect data"
    ghenv.Component.AddRuntimeMessage(gh.Kernel.GH_RuntimeMessageLevel.Warning, msg)
    
class MomentCurvature(object):
    def __init__(self, section, axialLoad, direction, maxPhi, numIncr=100):
        #^ y
        #|
        #|
        #|------> x
        self.section = section
        self.axialLoad = axialLoad
        self.direction = direction
        self.maxPhi = maxPhi
        self.numIncr= numIncr
        # Compute curvature increment
        #self.dK = self.maxK / self.numIncr
        self.secTag = 1
        

    def ToString(self):
        return self.write_tcl()

    def write_tcl(self):
        # Define two nodes at (0,0)
        clean = "wipe\n"
        model = "model BasicBuilder -ndm 3 -ndf 6\n"
        
        materialPath = ''.join([ i.material.write_tcl() for i in self.section.path ])
        materialLayer = ''.join([ i.material.write_tcl() for i in self.section.layer ])
        material = materialPath + materialLayer
        
        section = self.section.ToString()
        node1 = "node {} {} {} {}\n".format(1, self.section.centerSection.X, self.section.centerSection.Y, self.section.centerSection.Z)
        node2 = "node {} {} {} {}\n".format(2, self.section.centerSection.X, self.section.centerSection.Y, self.section.centerSection.Z)
        # Fix all degrees of freedom except axial and bending
        fix1 = "fix {} {} {} {} {} {} {}\n".format(1, 1, 1, 1, 1 ,1, 1) #node tag Fx Fy Fz Mx My Mz
        fix2 = "fix {} {} {} {} {} {} {}\n".format(2, 0, 1, 1, 1, 0, 0) #node tag Fx Fy Fz Mx My Mz
        # Define element
        ele = "element zeroLengthSection {} {} {} {}\n".format( 1, 1, 2, self.secTag) #-orient 1 0 0 1 0 0
        # Define constant axial load
        pattern = 'pattern Plain {} "{}" {}\n'.format( 1, 'Constant', "{;")   
        load = "load {} {} {} {} {} {} {};\n".format(2, self.axialLoad, 0.0, 0.0, 0.0, 0.0, 0.0) +  "}\n" 
        # analysis for constant axial load
        Integrator = "integrator LoadControl {}\n".format( 0.1)
        System = "system BandGeneral\n" #-piv
        Test = "test NormUnbalance {} {}\n".format( 1e-10, 1000)
        number = "numberer RCM\n"
        constraints = "constraints Plain\n"
        algorithm = "algorithm Newton\n"
        analysis = "analysis Static\n"
        # Do one analysis for constant axial load
        analyze = "analyze {}\n".format(10) 
        lC = "loadConst -time 0.0\n"
        # Define reference moment 
        recorder1 = "recorder Element -file MKsectionForce.out -ele 1 section force\n"
        recorder2 = "recorder Element -file MKsectionDef.out -ele 1 section deformation\n"
        patternM = 'pattern Plain {} "{}" {}\n'.format( 2, 'Linear', "{;")   
        # Use displacement control at node 2 for section analysis
        #IntegratorD = "integrator DisplacementControl {} {} {} {} {} {}\n".format(2,3,0.00035,1,self.dK,self.dK)
        if self.direction == 1 and self.maxPhi >0:
            directionID = 5
            loadM = "load {} {} {} {} {} {} {};\n".format(2, 0.0, 0.0, 0.0, 0.0, self.direction, 0.0) +  "}\n"
            
        elif self.direction == 2 and self.maxPhi >0:
            directionID = 6
            loadM = "load {} {} {} {} {} {} {};\n".format(2, 0.0, 0.0, 0.0, 0.0, 0.0, self.direction) +  "}\n" 
            
        elif self.direction == 1 and self.maxPhi <0:
            directionID = 5
            loadM = "load {} {} {} {} {} {} {};\n".format(2, 0.0, 0.0, 0.0, 0.0, -self.direction, 0.0) +  "}\n" 
            
        elif self.direction == 2 and self.maxPhi <0:
            directionID = 6
            loadM = "load {} {} {} {} {} {} {};\n".format(2, 0.0, 0.0, 0.0, 0.0, 0.0, -self.direction) +  "}\n" 
            
        IntegratorD = "integrator DisplacementControl {} {} {}\n".format(2,directionID,self.maxPhi/self.numIncr)
        #IntegratorD = 'integrator ' + self.Integrator.ToString() + "\n"
        analyze2 = "analyze {}\n".format(self.numIncr) + "\n" + "wipe"+ "\n"

        return clean + model + material + section +  node1 + node2 + fix1 + fix2 + ele + pattern + load + Integrator + System + Test + number + constraints + algorithm + analysis + analyze +lC + recorder1+ recorder2 + patternM + loadM + IntegratorD + analyze2


    def write_py(self):
        # Define two nodes at (0,0)


        return node1 + node2 + fix1 + fix2 + ele  + timeSeries + pattern + load + Integrator + System + test + number + constraints + algorithm + analysis + analyze + timeSeriesM + patternM + loadM + IntegratorD + analyze2


if checkData:
    FiberSection.secTag = 1

    for i, item in enumerate(FiberSection.path):
        item.material.matTag = i + 1
        #print(item.material.matTag )
    j = i+2
    for i, item in enumerate(FiberSection.layer):
        item.material.matTag = j + i
        print(j+i)
    
    MC = MomentCurvature(FiberSection, P, direction, maxPhi, nIncr)

script = MC.write_tcl()
#print(script)

outputFileName = 'openSeesSectionModel'
recorderFileName1 = 'MKsectionForce.out'
recorderFileName2 = 'MKsectionDef.out'

if checkData:
    FolderPath = rs.DocumentPath()
    os.chdir(FolderPath)

    
for dirpath, dirnames, filenames in os.walk(FolderPath):
    for filename in filenames:
        if filename == outputFileName:
            file = os.path.join(dirpath,outputFileName)
            filepath1 = os.path.join(dirpath,recorderFileName1)
            filepath2 = os.path.join(dirpath,recorderFileName2)
        elif filename == recorderFileName1:
            file1 = os.path.join(dirpath,recorderFileName1)
            file2 = os.path.join(dirpath,recorderFileName2)
            os.remove(file1)
            os.remove(file2)

time_start = time.clock()

with open(outputFileName, 'w') as f:
    for line in MC.write_tcl():
        f.write(line)
    f.close()

time_elapsed = (time.clock() - time_start)
#print("Writing Time {}".format(time_elapsed))


time_start = time.clock()

executable = os.path.join(ghcompfolder,'Alpaca4d\OpenSees-Solvers\opensees.bat')

#process = subprocess.Popen([r'C:\OpenSees\bin\OpenSees', outputFileName], shell = True, stdout=subprocess.PIPE, stderr=subprocess.PIPE)
process = subprocess.Popen([executable, outputFileName], shell = True,  stdout=subprocess.PIPE, stderr=subprocess.PIPE)
stdout, stderr = process.communicate()
print(stdout, stderr)
process.kill()

time_elapsed = (time.clock() - time_start)
print("Analyses Time {}".format(time_elapsed))




fileObj = open(filepath1, 'r')
words = fileObj.read().splitlines(" ")
#N = [ float(i.split()[0]) for i in words]
M1 = [ float(i.split()[1]) for i in words]
M2 = [ float(i.split()[2]) for i in words]
M3 = [ float(i.split()[3]) for i in words]
fileObj.close()
#FiberSection = [k, M]

fileObj = open(filepath2, 'r')
words = fileObj.read().splitlines(" ")
#N = [ float(i.split()[0]) for i in words]
k1 = [ float(i.split()[1]) for i in words]
k2 = [ float(i.split()[2]) for i in words]
k3 = [ float(i.split()[3]) for i in words]
fileObj.close()
# ---------- end mcm_2 ----------
panel_5 = Panel(mcm_2.script)

# ---- group: Material
panel_6 = Panel("-0.002")
panel_7 = Panel("-0.0035")
multiplication = Multiplication(A="-14.17", B=1000)
multiplication_2 = Multiplication(A="-14.17", B=1000)
multiplication_3 = Multiplication(A="200000.0", B=1000)
panel_8 = Panel("0.0")
multiplication_4 = Multiplication(A="391.3", B=1000)

# ----
# material
uemc01_2 = UniaxialElasticMaterialConcreate01Alpaca4d(fc=multiplication, fcu=multiplication_2, ec0=panel_6, ecu=panel_7)  # -> out, uniAxialMaterial
# ---------- uemc01_2: Python ----------
"""
Create a uniaxial Elastic Material Concreate01
-
    Args:
        fc:
        fcu:
        ec0:
        ecu:
    Returns:
        uniAxialMaterial:
"""

__author__ = "Ing. Domenico Gaudioso"
__contact__ = "DomenicoGaudioso@outlook.it"
__version__ = "2021.09.17"

ghenv.Component.Name = "uniaxial Elastic Material Concreate01 (Alpaca4d)"
ghenv.Component.NickName = 'UEMC01'
ghenv.Component.Message = "uniaxial Concreate01 (Alpaca4d)"

import sys
import Rhino.Geometry as rg
import Grasshopper as gh
import copy


## add alpaca install directory to system path

ghcompfolder = gh.Folders.DefaultAssemblyFolder
if ghcompfolder not in sys.path:
    sys.path.append(ghcompfolder)

try:
    from Alpaca4d import alpaca4d as alpaca
except:
    msg = "Cannot import Alpaca4d. Is the Alpaca4d folder available in " + ghcompfolder + "?"
    ghenv.Component.AddRuntimeMessage(gh.Kernel.GH_RuntimeMessageLevel.Error, msg)


checkData = True

if not fc:
    checkData = False
    msg = "Input parameter fc failed to collect data"
    ghenv.Component.AddRuntimeMessage(gh.Kernel.GH_RuntimeMessageLevel.Warning, msg)

if fcu == 'None':
    checkData = False
    msg = "Input parameter fcu failed to collect data"
    ghenv.Component.AddRuntimeMessage(gh.Kernel.GH_RuntimeMessageLevel.Warning, msg)

if not ec0:
    checkData = False
    msg = "Input parameter ec0 failed to collect data"
    ghenv.Component.AddRuntimeMessage(gh.Kernel.GH_RuntimeMessageLevel.Warning, msg)

if not ecu:
    checkData = False
    msg = "Input parameter ecu failed to collect data"
    ghenv.Component.AddRuntimeMessage(gh.Kernel.GH_RuntimeMessageLevel.Warning, msg)


class uniAxialMaterialConcreate01(object):
    def __init__(self, matName, MinMax, fc, ec0, fcu, ecu):
        '''Generate a uniaxial Elastic Material Concreate01
            link for information: https://opensees.berkeley.edu/wiki/index.php/Concrete01_Material_--_Zero_Tensile_Strength
            Inputs:
                matName: Name of the material.
                fc:  concrete compressive strength at 28 days (compression is negative) [MPa].
                fcu: concrete crushing strength[MPa].
                ec0: concrete strain at maximum strength.
                ecu: concrete strain at crushing strength.'''


        self.matName = matName
        self.MinMax = MinMax
        self.fc = fc
        self.fcu = fcu
        self.ec0 = ec0
        self.ecu = ecu
        self.tensionLimitPositive = 0.0
        self.tensionLimitNegative = self.fcu
        self.matTag = None
        self.matTagMinMax = None
        
        self.materialDimension = "uniAxialMaterial"
        self.materialType = "Concrete01"
        

    def ToString(self):
        return self.write_tcl()

    def write_tcl(self):
        a = "uniaxialMaterial Concrete01 {} {} {} {} {}\n".format(self.matTag, self.fc, self.ec0, self.fcu, self.ecu)
        if MinMax == None:
            return a
        else :
            MinMax.matTag = self.matTag
            MinMax.matTagMinMax = self.matTagMinMax
            return a + MinMax.ToString()
            
        
    def write_py(self):
        return "ops.uniaxialMaterial('Concrete01', {}, {}, {}, {}, {})\n".format(self.matTag, self.fc, self.ec0, self.fcu, self.ecu)


if checkData:
    uniAxialMaterial = uniAxialMaterialConcreate01(name, MinMax, fc, ec0, fcu, ecu)
# ---------- end uemc01_2 ----------
uems01_2 = UniaxialElasticMaterialSteel01Alpaca4d(MinMax=minmax.MinMax, fy=multiplication_4, E0=multiplication_3, b=panel_8)  # -> out, uniAxialMaterial
# ---------- uems01_2: Python ----------
"""
Create a uniaxial Elastic Material Concreate01
-
    Args:
        fc:
        fcu:
        ec0:
        ecu:
    Returns:
        uniAxialMaterial:
"""

__author__ = "Ing. Domenico Gaudioso"
__contact__ = "DomenicoGaudioso@outlook.it"
__version__ = "2021.09.17"

ghenv.Component.Name = "uniaxial Elastic Material Steel01 (Alpaca4d)"
ghenv.Component.NickName = 'UEMS01'
ghenv.Component.Message = "uniaxial Steel01 (Alpaca4d)"

import sys
import Rhino.Geometry as rg
import Grasshopper as gh
import copy


## add alpaca install directory to system path

ghcompfolder = gh.Folders.DefaultAssemblyFolder
if ghcompfolder not in sys.path:
    sys.path.append(ghcompfolder)


   
   
try:
    from Alpaca4d import alpaca4d as alpaca
except:
    msg = "Cannot import Alpaca4d. Is the Alpaca4d folder available in " + ghcompfolder + "?"
    ghenv.Component.AddRuntimeMessage(gh.Kernel.GH_RuntimeMessageLevel.Error, msg)

print(a1!=None, a2, a3, a4)

checkData = True

if not fy:
    checkData = False
    msg = "Input parameter fy failed to collect data"
    ghenv.Component.AddRuntimeMessage(gh.Kernel.GH_RuntimeMessageLevel.Warning, msg)

if not E0:
    checkData = False
    msg = "Input parameter E0 failed to collect data"
    ghenv.Component.AddRuntimeMessage(gh.Kernel.GH_RuntimeMessageLevel.Warning, msg)
    
"""
if not b:
    checkData = False
    msg = "Input parameter b failed to collect data"
    ghenv.Component.AddRuntimeMessage(gh.Kernel.GH_RuntimeMessageLevel.Warning, msg)
"""

class uniAxialMaterialSteel01(object):
    def __init__(self, matName, MinMax, fy, E0, b, a1=1.0, a2=1.0, a3=1.0, a4=1.0):
        '''Generate a uniaxial Elastic Material Steel01
            link for information: https://opensees.berkeley.edu/wiki/index.php/Steel01_Material
            Inputs:
                matName: Name of the material.
                fy: yield strength [MPa].
                E0: initial elastic tangent[MPa].
                b: strain-hardening ratio (ratio between post-yield tangent and initial elastic tangent).
                a1: isotropic hardening parameter, increase of compression yield envelope as proportion of yield strength after a plastic strain of $a2*($Fy/E0). (optional).
                a2: isotropic hardening parameter (see explanation under $a1). (optional).
                a3: isotropic hardening parameter, increase of tension yield envelope as proportion of yield strength after a plastic strain of $a4*($Fy/E0). (optional)
                a4: isotropic hardening parameter (see explanation under $a3). (optional)'''

        self.matName = matName
        self.MinMax = MinMax
        self.fy = fy
        self.E0 = E0
        self.b = b
        self.a1 = a1
        self.a2 = a2
        self.a3 = a3
        self.a4 = a4
        
        self.tensionLimitPositive = self.fy
        self.tensionLimitNegative = -self.fy
        
        self.matTag = None
        self.matTagMinMax = None
        
        self.materialDimension = "uniAxialMaterial"
        self.materialType = "Steel01"
        
        self.esh = self.fy/self.E0
        self.eult = 6.75/100

    def ToString(self):
        return self.write_tcl()

    def write_tcl(self):
        a = "uniaxialMaterial Steel01 {} {} {} {} {} {} {} {}\n".format(self.matTag, self.fy, self.E0, self.b, self.a1, self.a2, self.a3, self.a4 ) 
        if MinMax == None:
            return a
        else :
            MinMax.matTag = self.matTag
            MinMax.matTagMinMax = self.matTagMinMax
            return a + MinMax.ToString()


if checkData:
    uniAxialMaterial = uniAxialMaterialSteel01(name, MinMax, fy, E0, b, a1, a2, a3, a4)
# ---------- end uems01_2 ----------

# ---- group: Material (continued)
panel_9 = Panel(uemc01_2.uniAxialMaterial)
panel_10 = Panel(uems01_2.uniAxialMaterial)

# ----
l_2 = LayerAlpaca4d(material=uems01_2.uniAxialMaterial, line=[crv_2, crv], nBar=Slider(4, range=0..10), diameter=number_slider)  # -> out, layer, layerCircle; inputs line: Curve, nBar: Int32, diameter: Int32
# ---------- l_2: Python ----------
"""
Create path
-
    Args:
        material: material component.
        polyC: polyline with 4 node (only 4 node).
        nBar:  number of fibers along line
        diameter: 	diameter bar (mm)
            Inputs:
                
                
                
            
    Returns:
        uniAxialMaterial:
"""
__author__ = "Ing. Domenico Gaudioso"
__contact__ = "DomenicoGaudioso@outlook.it"
__version__ = "2021.09.17"

ghenv.Component.Name = "layer (Alpaca4d)"
ghenv.Component.NickName = 'l'
ghenv.Component.Message = "layer (Alpaca4d)"

import sys
import Rhino.Geometry as rg
import Grasshopper as gh
import copy


## add alpaca install directory to system path

ghcompfolder = gh.Folders.DefaultAssemblyFolder
if ghcompfolder not in sys.path:
    sys.path.append(ghcompfolder)

try:
    from Alpaca4d import alpaca4d as alpaca
except:
    msg = "Cannot import Alpaca4d. Is the Alpaca4d folder available in " + ghcompfolder + "?"
    ghenv.Component.AddRuntimeMessage(gh.Kernel.GH_RuntimeMessageLevel.Error, msg)


checkData = True

if not material:
    checkData = False
    msg = "Input parameter material failed to collect data"
    ghenv.Component.AddRuntimeMessage(gh.Kernel.GH_RuntimeMessageLevel.Warning, msg)

if not line:
    checkData = False
    msg = "Input parameter line failed to collect data"
    ghenv.Component.AddRuntimeMessage(gh.Kernel.GH_RuntimeMessageLevel.Warning, msg)

if not nBar:
    checkData = False
    msg = "Input parameter nBar failed to collect data"
    ghenv.Component.AddRuntimeMessage(gh.Kernel.GH_RuntimeMessageLevel.Warning, msg)

if not diameter:
    checkData = False
    msg = "Input parameter diameter failed to collect data"
    ghenv.Component.AddRuntimeMessage(gh.Kernel.GH_RuntimeMessageLevel.Warning, msg)

import rhinoscriptsyntax as rs
import Rhino.Geometry as rg
import math as mt
import ghpythonlib.components as ghcomp

#a = rg.Mesh.CreateFromSurface(surf4N, rg.MeshingParameters.Default)


class layer(object):
    def __init__(self, material, line, nBar, diameter):
        """ Generate fiber
            link for information: https://opensees.berkeley.edu/wiki/index.php/Layer_Command
            Inputs:
                matName: Name of the material.
                nBar:  number of fibers along line
        """
        
        self.material = material
        self.line = line
        self.nBar = nBar 
        self.diameter = diameter/1000
        
        area = (mt.pi*self.diameter**2/4)
        self.Atot = area #*self.nBar 
        pAt = self.line.DivideByCount(self.nBar - 1, True)
        self.Point = [ self.line.PointAt(pAt[i]) for i in range(len(pAt))]
        self.layerSurf = [ rg.Circle(iPoint, self.diameter/2) for iPoint in self.Point ]
        
        

    def ToString(self):
        return self.write_tcl()

    def write_tcl(self):
        return "layer straight {} {} {} {} {} {} {};\n".format(self.material.matTag, self.nBar, self.Atot, self.line.PointAtStart.X, self.line.PointAtStart.Y, self.line.PointAtEnd.X, self.line.PointAtEnd.Y )


if checkData:
    mat = copy.copy(material)
    layer = layer(mat, line, nBar, diameter)
    layerCircle = layer.layerSurf
# ---------- end l_2 ----------
panel_11 = Panel(l_2.layer)
srf = Surface(l_2.layerCircle)

# ----
# patch & layer
P_2 = PathAlpaca4d(material=uemc01_2.uniAxialMaterial, polyC=rectangle.Rectangle, U=Slider(20, range=0..20), V=Slider(50, range=0..100))  # -> out, path, pathSurf; inputs polyC: Curve, U: Int32, V: Int32; same code as P

panel_12 = Panel(P_2.path)

# ----
# Fiber section
python_2 = GhPythonScript(path=flatten(P_2.path), layer=flatten(l_2.layer))  # -> out, FiberSection, FiberMesh, PropSection; inputs fiber: list, path: list, layer: list; same code as python

# ---- group: Cross-Section
mcol = MeshColours(Mesh=python_2.FiberMesh, Colours=ColourSwatch(SwatchColor=RGBA(249, 255, 84, 120)))
panel_13 = Panel(python_2.FiberMesh)

# ----
mnm_2 = MNModelAlpaca4d(FiberSection=python_2.FiberMesh, direction=number_slider_6, nPoint=Slider(30, range=0..100))  # -> out, N, M; inputs nPoint: Int32
# ---------- mnm_2: Python ----------
"""
Run an OpenSees Analysis
-
    Args:
        FiberSection:
        direction: 1 for M2 and 2 for M1. Default is 1 
        nPoint: number of Point for make de N-M domain
    Returns:
        N: axial load valor
        M: bending moment valor
"""



import Rhino.RhinoDoc
import Grasshopper as gh
import copy
import rhinoscriptsyntax as rs
import Rhino.Geometry as rg
import os
import time
import sys
import subprocess
import ghpythonlib.treehelpers as th
import math as mt
import ghpythonlib.parallel as ghp


__author__ = "Ing. Domenico Gaudioso"
__contact__ = "DomenicoGaudioso@outlook.it"
__version__ = "2021.09.17"

ghenv.Component.Name = "M-N Model (Alpaca4d)"
ghenv.Component.NickName = 'MNM'
ghenv.Component.Message = "M-N Model (Alpaca4d)"

ghcompfolder = gh.Folders.DefaultAssemblyFolder
if ghcompfolder not in sys.path:
    sys.path.append(ghcompfolder)

try:
    from Alpaca4d import alpaca4d as alpaca
except:
    msg = "Cannot import Alpaca4d. Is the Alpaca4d folder available in " + ghcompfolder + "?"
    ghenv.Component.AddRuntimeMessage(gh.Kernel.GH_RuntimeMessageLevel.Error, msg)


checkData = True


if not FiberSection:
    checkData = False
    msg = "Input parameter AlpacaModel failed to collect data"
    ghenv.Component.AddRuntimeMessage(gh.Kernel.GH_RuntimeMessageLevel.Warning, msg)
    
if direction == None:
    direction = 1
    
def linspace(start, stop, len):
    step = (mt.fabs(start)+stop)/(len-1)
    return [start + step*interval for interval in range(len)]
        
def RunMCpositive(Pi): 
    if Pi > 0.0:
        recorderFileName = "MKsectionP{}positiveMpositive".format(int(mt.fabs(Pi)))
        outputFileName = "OSSModel{}positiveMpositive".format(int(mt.fabs(Pi)))
    elif Pi < 0.0:
        recorderFileName = "MKsectionP{}negativeMpositive".format(int(mt.fabs(Pi)))
        outputFileName = "OSSModel{}negativeMpositive".format(int(mt.fabs(Pi)))
        
    if direction == 1:
        alpha = 0.0
    else:
        alpha = 90.0
            
    MC = alpaca.MomentCurvature(recorderFileName,FiberSection, float(Pi), alpha, 2.0, 1000) #mu*FiberSection.Ky
    script = MC.write_tcl()
    
    FolderPath = rs.DocumentPath()
    os.chdir(FolderPath)
        
    recorderFileName1 = recorderFileName + "Force" + ".out"
    recorderFileName2 = recorderFileName + "Disp" + ".out"
    
    runFileName = os.path.join(FolderPath,outputFileName)
    filepath1 = os.path.join(FolderPath,recorderFileName1)
    #filepath2 = os.path.join(FolderPath,recorderFileName2)
    """
    if os.path.exists(runFileName):
      os.remove(runFileName)
      os.remove(filepath1)
      os.remove(filepath1)
    else:
      print("The file does not exist")
    """
    time_start = time.clock()
    
    with open(outputFileName, 'w') as f:
        for line in MC.write_tcl():
            f.write(line)
        f.close()
    
    time_elapsed = (time.clock() - time_start)
    #print("Writing Time {}".format(time_elapsed))
    
    time_start = time.clock()
    
    executable = os.path.join(ghcompfolder,'Alpaca4d\OpenSees-Solvers\opensees.bat')
    #executable = os.path.join(ghcompfolder,'C:\OpenSees\bin\opensees.bat')
    
    #process = subprocess.Popen([r'C:\OpenSees\bin\OpenSees', outputFileName], shell = True, stdout=subprocess.PIPE, stderr=subprocess.PIPE)
    process = subprocess.Popen([executable, outputFileName], shell = True,  stdout=subprocess.PIPE, stderr=subprocess.PIPE)
    stdout, stderr = process.communicate()
    #print(stdout, stderr)
    process.kill()
    os.remove(runFileName)
    time_elapsed = (time.clock() - time_start)
    #print("Analyses Time {}".format(time_elapsed))
    #filepath = os.path.join(r'C:\OpenSees\bin',recorderFileName)
    fileObj = open(filepath1, 'r')
    words = fileObj.read().splitlines(" ")
    #print(fileObj.read())
    N = "None"
    if len(words) != 0:
        N = float(words[-1].split()[0])
        M1 = float(words[-1].split()[1])
        M2 = float(words[-1].split()[2])
    fileObj.close()

    os.remove(filepath1)
    """
    fileObj = open(filepath2, 'r')
    words = fileObj.read().splitlines(" ")
    #print(fileObj.read())

    k1 = [ float(i.split()[1]) for i in words]
    k2 = [ float(i.split()[2]) for i in words]
    k3 = [ float(i.split()[3]) for i in words]
    fileObj.close()
    """
    #os.remove(filepath2)
    if N != "None" :
        return [N, M1, M2]


def RunMCnegative(Pi): 

    if Pi > 0.0:
        recorderFileName = "MKsectionP{}positiveMnegative".format(int(mt.fabs(Pi)))
        outputFileName = "OSSModel{}positiveMnegative".format(int(mt.fabs(Pi)))
    elif Pi < 0.0:
        recorderFileName = "MKsectionP{}negativeMnegative".format(int(mt.fabs(Pi)))
        outputFileName = "OSSModel{}negativeMnegative".format(int(mt.fabs(Pi)))
        
    if direction == 1:
        alpha = 180.00
    else:
        alpha = 270.00
            
    MC = alpaca.MomentCurvature(recorderFileName,FiberSection, float(Pi), alpha, 2.0, 1000)
    script = MC.write_tcl()
    
    FolderPath = rs.DocumentPath()
    os.chdir(FolderPath)
        
    recorderFileName1 = recorderFileName + "Force" + ".out"
    recorderFileName2 = recorderFileName + "Disp" + ".out"
    
    runFileName = os.path.join(FolderPath,outputFileName)
    filepath1 = os.path.join(FolderPath,recorderFileName1)
    #filepath2 = os.path.join(FolderPath,recorderFileName2)
    """
    if os.path.exists(runFileName):
      os.remove(runFileName)
      os.remove(filepath1)
      os.remove(filepath1)
    else:
      print("The file does not exist")
      """
    time_start = time.clock()
    
    with open(outputFileName, 'w') as f:
        for line in MC.write_tcl():
            f.write(line)
        f.close()
    
    time_elapsed = (time.clock() - time_start)
    #print("Writing Time {}".format(time_elapsed))
    
    time_start = time.clock()
    
    executable = os.path.join(ghcompfolder,'Alpaca4d\OpenSees-Solvers\opensees.bat')
    #executable = os.path.join(ghcompfolder,'C:\OpenSees\bin\opensees.bat')
    
    #process = subprocess.Popen([r'C:\OpenSees\bin\OpenSees', outputFileName], shell = True, stdout=subprocess.PIPE, stderr=subprocess.PIPE)
    process = subprocess.Popen([executable, outputFileName], shell = True,  stdout=subprocess.PIPE, stderr=subprocess.PIPE)
    stdout, stderr = process.communicate()
    #print(stdout, stderr)
    process.kill()
    os.remove(runFileName)
    time_elapsed = (time.clock() - time_start)
    #print("Analyses Time {}".format(time_elapsed))
    #filepath = os.path.join(r'C:\OpenSees\bin',recorderFileName)
    fileObj = open(filepath1, 'r')
    words = fileObj.read().splitlines(" ")
    #print(fileObj.read())
    N = "None"
    if len(words) != 0:
        N = float(words[-1].split()[0])
        M1 = float(words[-1].split()[1])
        M2 = float(words[-1].split()[2])
    fileObj.close()

    os.remove(filepath1)
    """
    fileObj = open(filepath2, 'r')
    words = fileObj.read().splitlines(" ")
    #print(fileObj.read())

    k1 = [ float(i.split()[1]) for i in words]
    k2 = [ float(i.split()[2]) for i in words]
    k3 = [ float(i.split()[3]) for i in words]
    fileObj.close()
    """
    #os.remove(filepath2)
    if N != "None" :
        return [N, M1, M2]
        
        

if checkData:
    centerForce = rg.Point3d(FiberSection.centerSection.X, FiberSection.centerSection.Y, FiberSection.centerSection.Z)
### ASSEMBLE ###
    FiberSection.secTag = 1
    for i, item in enumerate(FiberSection.path):
        item.material.matTag = 2*(i+1)
        item.material.matTagMinMax = 2*i+1
        #print(item.material.matTag )
    j = i+2
    for i, item in enumerate(FiberSection.layer):
        j = j + i 
        item.material.matTag = 2*(j+1)
        item.material.matTagMinMax = 2*j+1
        #print(j+i)
    w = j+2
    for i, item in enumerate(FiberSection.fiber):
        w = w + i 
        item.material.matTag = 2*(w+1)
        item.material.matTagMinMax = 2*w+1
        
#A = ghp.run(RunNEps,[-1.0, 1.0], True)

        
    print(FiberSection.NultNeg+0.1*FiberSection.NultNeg,FiberSection.NultPos)
    
    
    #n1 = int(mt.fabs(min(A)/stepValorPositive))
    #n2 = int(mt.fabs(max(A)/stepValorNegative))
    
    #listP = linspace(min(A), -5.0, n1) + linspace(5, max(A)-10.0, n2)
    
    if nPoint == None:
        nPoint = 10
        
    listP = linspace(FiberSection.NultNeg,FiberSection.NultPos, nPoint)
    
    
    B = ghp.run(RunMCpositive, listP,False)
    C = ghp.run(RunMCnegative, listP,False)
    
    #print(D[7])
    #RunM1Cpositive(Pi): 
    
    
    Nupos, Nuneg = [], []
    M1uP, M2uP = [], []
    M1uN, M2uN = [], []
    
    B =filter(None, B) #elimino il None
    C =filter(None, C) 
    
    for item in B:
        Nupos.append(item[0])
        M1uP.append( item[1])
        M2uP.append( item[2])
        #M3uP.append( item[3])
        
    for item in C:
        Nuneg.append(item[0])
        M1uN.append( item[1])
        M2uN.append( item[2])
    
    M1 = M1uN + M1uP[::-1] + M1uN[0:1]
    M2 = M2uN + M2uP[::-1] + M2uN[0:1]
    N = Nuneg + Nupos[::-1] + Nuneg[0:1]
    
    if direction == 1:
        M = M2
    else:
        M = M1
# ---------- end mnm_2 ----------

mnm_3 = MNModelAlpaca4d(FiberSection=python_2.FiberMesh)  # -> out, N, k1, k2, k3, M1, M2, M3, M1u, M2u
# ---------- mnm_3: Python ----------
"""
Run an OpenSees Analysis
-
    Args:
        FiberSection:
        P: axial load 
        mu: Target ductility for analysis
        nIncr: Number of analysis increments
    Returns:
        AlpacaSolvedModel:
"""



import Rhino.RhinoDoc
import Grasshopper as gh
import copy
import rhinoscriptsyntax as rs
import Rhino.Geometry as rg
import os
import time
import sys
import subprocess
import ghpythonlib.treehelpers as th
import math as mt
import ghpythonlib.parallel as ghp



ghenv.Component.Name = "M-N Model (Alpaca4d)"
ghenv.Component.NickName = 'MNM'
ghenv.Component.Message = "M-N Model (Alpaca4d)"

ghcompfolder = gh.Folders.DefaultAssemblyFolder
if ghcompfolder not in sys.path:
    sys.path.append(ghcompfolder)

try:
    from Alpaca4d import alpaca4d as alpaca
except:
    msg = "Cannot import Alpaca4d. Is the Alpaca4d folder available in " + ghcompfolder + "?"
    ghenv.Component.AddRuntimeMessage(gh.Kernel.GH_RuntimeMessageLevel.Error, msg)


checkData = True



if not FiberSection:
    checkData = False
    msg = "Input parameter AlpacaModel failed to collect data"
    ghenv.Component.AddRuntimeMessage(gh.Kernel.GH_RuntimeMessageLevel.Warning, msg)
    
class MomentCurvature(object):
    def __init__(self, recorderName, section, axialLoad, direction, maxPhi, numIncr=100):
        #^ y
        #|
        #|
        #|------> x
        self.recorderName = recorderName
        self.section = section
        self.axialLoad = axialLoad
        self.direction = direction
        self.maxPhi = maxPhi
        self.numIncr= numIncr
        # Compute curvature increment
        #self.dK = self.maxK / self.numIncr
        self.secTag = 1
        

    def ToString(self):
        return self.write_tcl()

    def write_tcl(self):
        # Define two nodes at (0,0)
        clean = "wipe\n"
        model = "model BasicBuilder -ndm 3 -ndf 6\n"
        
        materialPath = ''.join([ i.material.write_tcl() for i in self.section.path ])
        materialLayer = ''.join([ i.material.write_tcl() for i in self.section.layer ])
        material = materialPath + materialLayer
        
        section = self.section.ToString()
        node1 = "node {} {} {} {}\n".format(1, self.section.centerSection.X, self.section.centerSection.Y, self.section.centerSection.Z)
        node2 = "node {} {} {} {}\n".format(2, self.section.centerSection.X, self.section.centerSection.Y, self.section.centerSection.Z)
        # Fix all degrees of freedom except axial and bending
        fix1 = "fix {} {} {} {} {} {} {}\n".format(1, 1, 1, 1, 1 ,1, 1) #node tag Fx Fy Fz Mx My Mz
        fix2 = "fix {} {} {} {} {} {} {}\n".format(2, 0, 1, 1, 1, 0, 0) #node tag Fx Fy Fz Mx My Mz
        # Define element
        ele = "element zeroLengthSection {} {} {} {}\n".format( 1, 1, 2, self.secTag) #-orient 1 0 0 1 0 0
        # Define constant axial load
        pattern = 'pattern Plain {} "{}" {}\n'.format( 1, 'Constant', "{;")   
        load = "load {} {} {} {} {} {} {};\n".format(2, self.axialLoad, 0.0, 0.0, 0.0, 0.0, 0.0) +  "}\n" 
        # analysis for constant axial load
        Integrator = "integrator LoadControl {}\n".format( 0.1)
        System = "system BandGeneral\n" #-piv
        Test = "test NormUnbalance {} {}\n".format( 1e-10, 1000)
        number = "numberer RCM\n"
        constraints = "constraints Plain\n"
        algorithm = "algorithm Newton\n"
        analysis = "analysis Static\n"
        # Do one analysis for constant axial load
        analyze = "analyze {}\n".format(10) 
        lC = "loadConst -time 0.0\n"
        # Define reference moment 
        recorderName1 = self.recorderName + "Force" + ".out"
        recorderName2 = self.recorderName + "Disp" + ".out"
        recorder1 = "recorder Element -file {} -ele 1 section force\n".format(recorderName1)
        recorder2 = "recorder Element -file {} -ele 1 section deformation\n".format(recorderName2)
        patternM = 'pattern Plain {} "{}" {}\n'.format( 2, 'Linear', "{;")   
        # Use displacement control at node 2 for section analysis
        #IntegratorD = "integrator DisplacementControl {} {} {} {} {} {}\n".format(2,3,0.00035,1,self.dK,self.dK)
        if self.direction == 1 and self.maxPhi >0:
            directionID = 5
            loadM = "load {} {} {} {} {} {} {};\n".format(2, 0.0, 0.0, 0.0, 0.0, self.direction, 0.0) +  "}\n"
            
        elif self.direction == 2 and self.maxPhi >0:
            directionID = 6
            loadM = "load {} {} {} {} {} {} {};\n".format(2, 0.0, 0.0, 0.0, 0.0, 0.0, self.direction) +  "}\n" 
            
        elif self.direction == 1 and self.maxPhi <0:
            directionID = 5
            loadM = "load {} {} {} {} {} {} {};\n".format(2, 0.0, 0.0, 0.0, 0.0, -self.direction, 0.0) +  "}\n" 
            
        elif self.direction == 2 and self.maxPhi <0:
            directionID = 6
            loadM = "load {} {} {} {} {} {} {};\n".format(2, 0.0, 0.0, 0.0, 0.0, 0.0, -self.direction) +  "}\n" 
            
        IntegratorD = "integrator DisplacementControl {} {} {} {}\n".format(2,directionID,self.maxPhi/self.numIncr, 20) #node dof incr numIter
        #IntegratorD = 'integrator ' + self.Integrator.ToString() + "\n"
        analyze2 = "analyze {}\n".format(self.numIncr) + "\n" + "wipe"+ "\n"

        return clean + model + material + section +  node1 + node2 + fix1 + fix2 + ele + pattern + load + Integrator + System + Test + number + constraints + algorithm + analysis + analyze +lC + recorder1+ recorder2 + patternM + loadM + IntegratorD + analyze2


    def write_py(self):
        # Define two nodes at (0,0)


        return node1 + node2 + fix1 + fix2 + ele  + timeSeries + pattern + load + Integrator + System + test + number + constraints + algorithm + analysis + analyze + timeSeriesM + patternM + loadM + IntegratorD + analyze2

class AxialForceEpsilon(object):
    def __init__(self, recorderName, section, direction =1, numIncr=2000):
        #^ y
        #|
        #|
        #|------> x
        self.recorderName = recorderName
        self.section = section
        self.direction = direction
        self.numIncr= numIncr
        # Compute curvature increment
        #self.dK = self.maxK / self.numIncr
        self.secTag = 1
        

    def ToString(self):
        return self.write_tcl()

    def write_tcl(self):
        # Define two nodes at (0,0)
        clean = "wipe\n"
        model = "model BasicBuilder -ndm 2 -ndf 3\n"
        
        materialPath = ''.join([ i.material.write_tcl() for i in self.section.path ])
        materialLayer = ''.join([ i.material.write_tcl() for i in self.section.layer ])
        material = materialPath + materialLayer
        
        section = self.section.ToString()
        node1 = "node {} {} {}\n".format(1, self.section.centerSection.X, self.section.centerSection.Y)
        node2 = "node {} {} {}\n".format(2, self.section.centerSection.X, self.section.centerSection.Y)
        # Fix all degrees of freedom except axial and bending
        fix1 = "fix {} {} {} {}\n".format(1, 1, 1, 1) #node tag Fx Fy Fz Mx My Mz
        fix2 = "fix {} {} {} {}\n".format(2, 0, 1, 1) #node tag Fx Fy Fz Mx My Mz
        # Define element
        ele = "element zeroLengthSection {} {} {} {}\n".format( 1, 1, 2, self.secTag) #-orient 1 0 0 1 0 0
        # Define constant axial load

        pattern = 'pattern Plain {} "{}" {}\n'.format( 1, 'Linear', "{;")   
        if self.direction > 0.0:
            dir = 0.1
            load = "load {} {} {} {};\n".format(2, dir, 0.0, 0.0) +  "}\n"
            print("Positive")
        else :
            dir = -0.1
            load = "load {} {} {} {};\n".format(2, dir, 0.0, 0.0) +  "}\n"         
            print("negative")
        recorderName1 = self.recorderName + "Force" + ".out"
        recorderName2 = self.recorderName + "Disp" + ".out"
        recorder1 = "recorder Element -file {} -ele 1 section force\n".format(recorderName1)
        recorder2 = "recorder Element -file {} -ele 1 section deformation\n".format(recorderName2)
        
        
        Integrator = "integrator LoadControl {} {}\n".format(10, 100)
        System = "system BandGeneral\n" #-piv
        Test = "test NormUnbalance {} {}\n".format( 1e-09, 1000)
        number = "numberer RCM\n"
        constraints = "constraints Plain\n"
        algorithm = "algorithm Newton\n"
        analysis = "analysis Static\n"
        # Do one analysis for constant axial load
        analyze = "analyze {}\n".format(self.numIncr) + "\n" + "wipe"+ "\n"
        # Define reference moment 

        return clean + model + material + section +  node1 + node2 + fix1 + fix2 + ele + pattern + load + recorder1+ recorder2 + Integrator + System + Test + number + constraints + algorithm + analysis + analyze 


def RunMCpositive(Pi): 
    if Pi > 0.0:
        recorderFileName = "MKsectionP{}positiveMpositive".format(int(mt.fabs(Pi)))
        outputFileName = "OSSModel{}positiveMpositive".format(int(mt.fabs(Pi)))
    elif Pi < 0.0:
        recorderFileName = "MKsectionP{}negativeMpositive".format(int(mt.fabs(Pi)))
        outputFileName = "OSSModel{}negativeMpositive".format(int(mt.fabs(Pi)))
        
    MC = MomentCurvature(recorderFileName,FiberSection, float(Pi), 1, 1.0, 1000) #mu*FiberSection.Ky
    script = MC.write_tcl()
    
    FolderPath = rs.DocumentPath()
    os.chdir(FolderPath)
        
    recorderFileName1 = recorderFileName + "Force" + ".out"
    recorderFileName2 = recorderFileName + "Disp" + ".out"
    
    runFileName = os.path.join(FolderPath,outputFileName)
    filepath1 = os.path.join(FolderPath,recorderFileName1)
    filepath2 = os.path.join(FolderPath,recorderFileName2)
    
    time_start = time.clock()
    
    with open(outputFileName, 'w') as f:
        for line in MC.write_tcl():
            f.write(line)
        f.close()
    
    time_elapsed = (time.clock() - time_start)
    #print("Writing Time {}".format(time_elapsed))
    
    time_start = time.clock()
    
    executable = os.path.join(ghcompfolder,'Alpaca4d\OpenSees-Solvers\opensees.bat')
    #executable = os.path.join(ghcompfolder,'C:\OpenSees\bin\opensees.bat')
    
    #process = subprocess.Popen([r'C:\OpenSees\bin\OpenSees', outputFileName], shell = True, stdout=subprocess.PIPE, stderr=subprocess.PIPE)
    process = subprocess.Popen([executable, outputFileName], shell = True,  stdout=subprocess.PIPE, stderr=subprocess.PIPE)
    stdout, stderr = process.communicate()
    #print(stdout, stderr)
    process.kill()
    
    time_elapsed = (time.clock() - time_start)
    #print("Analyses Time {}".format(time_elapsed))
    #filepath = os.path.join(r'C:\OpenSees\bin',recorderFileName)
    fileObj = open(filepath1, 'r')
    words = fileObj.read().splitlines(" ")
    #print(fileObj.read())
    N = [ float(i.split()[0]) for i in words]
    M1 = [ float(i.split()[1]) for i in words]
    M2 = [ float(i.split()[2]) for i in words]
    M3 = [ float(i.split()[3]) for i in words]
    fileObj.close()
    os.remove(runFileName)
    os.remove(filepath1)
    fileObj = open(filepath2, 'r')
    words = fileObj.read().splitlines(" ")
    #print(fileObj.read())
    k1 = [ float(i.split()[1]) for i in words]
    k2 = [ float(i.split()[2]) for i in words]
    k3 = [ float(i.split()[3]) for i in words]
    fileObj.close()
    os.remove(filepath2)
    return [k1, k2, k3, N, M1, M2, M3]


def RunMCnegative(Pi): 

    if Pi > 0.0:
        recorderFileName = "MKsectionP{}positiveMnegative".format(int(mt.fabs(Pi)))
        outputFileName = "OSSModel{}positiveMnegative".format(int(mt.fabs(Pi)))
    elif Pi < 0.0:
        recorderFileName = "MKsectionP{}negativeMnegative".format(int(mt.fabs(Pi)))
        outputFileName = "OSSModel{}negativeMnegative".format(int(mt.fabs(Pi)))
        
    MC = MomentCurvature(recorderFileName,FiberSection, float(Pi), 1, -1.0, 1000) #mu*FiberSection.Ky
    script = MC.write_tcl()
    
    FolderPath = rs.DocumentPath()
    os.chdir(FolderPath)
        
    recorderFileName1 = recorderFileName + "Force" + ".out"
    recorderFileName2 = recorderFileName + "Disp" + ".out"
    
    runFileName = os.path.join(FolderPath,outputFileName)
    filepath1 = os.path.join(FolderPath,recorderFileName1)
    filepath2 = os.path.join(FolderPath,recorderFileName2)
    """
    if os.path.exists(runFileName):
      os.remove(runFileName)
    else:
      print("The file does not exist")
    """
    time_start = time.clock()
    
    with open(outputFileName, 'w') as f:
        for line in MC.write_tcl():
            f.write(line)
        f.close()
    
    time_elapsed = (time.clock() - time_start)
    #print("Writing Time {}".format(time_elapsed))
    
    time_start = time.clock()
    
    executable = os.path.join(ghcompfolder,'Alpaca4d\OpenSees-Solvers\opensees.bat')
    #executable = os.path.join(ghcompfolder,'C:\OpenSees\bin\opensees.bat')
    
    #process = subprocess.Popen([r'C:\OpenSees\bin\OpenSees', outputFileName], shell = True, stdout=subprocess.PIPE, stderr=subprocess.PIPE)
    process = subprocess.Popen([executable, outputFileName], shell = True,  stdout=subprocess.PIPE, stderr=subprocess.PIPE)
    stdout, stderr = process.communicate()
    #print(stdout, stderr)
    process.kill()
    
    time_elapsed = (time.clock() - time_start)
    #print("Analyses Time {}".format(time_elapsed))
    #filepath = os.path.join(r'C:\OpenSees\bin',recorderFileName)
    fileObj = open(filepath1, 'r')
    words = fileObj.read().splitlines(" ")
    #print(fileObj.read())
    N = [ float(i.split()[0]) for i in words]
    M1 = [ float(i.split()[1]) for i in words]
    M2 = [ float(i.split()[2]) for i in words]
    M3 = [ float(i.split()[3]) for i in words]
    fileObj.close()
    os.remove(runFileName)
    os.remove(filepath1)
    fileObj = open(filepath2, 'r')
    words = fileObj.read().splitlines(" ")
    #print(fileObj.read())
    k1 = [ float(i.split()[1]) for i in words]
    k2 = [ float(i.split()[2]) for i in words]
    k3 = [ float(i.split()[3]) for i in words]
    fileObj.close()
    os.remove(filepath2)
    return [k1, k2, k3, N, M1, M2, M3]

def RunNEps(dir): 
    print(dir)
    if dir >0 :
        recorderFileName = 'NEpsSectionPositive' # da risolvere per il nome del file
        outputFileName = 'OSSModelNpositive'
    else:
        recorderFileName = 'NEpsSectionNegative' # da risolvere per il nome del file
        outputFileName = 'OSSModelNnegative'
    NEps = AxialForceEpsilon(recorderFileName,FiberSection, dir,5000) #mu*FiberSection.Ky
    script = NEps.write_tcl()

    
    FolderPath = rs.DocumentPath()
    os.chdir(FolderPath)
        
    recorderFileName1 = recorderFileName + "Force" + ".out"
    recorderFileName2 = recorderFileName + "Disp" + ".out"
    
        
    runFileName = os.path.join(FolderPath,outputFileName)
    filepath1 = os.path.join(FolderPath,recorderFileName1)
    filepath2 = os.path.join(FolderPath,recorderFileName2)
    
    if os.path.exists(runFileName):
      os.remove(runFileName)
    else:
      print("The file does not exist")
      
    
    time_start = time.clock()
    
    with open(outputFileName, 'w') as f:
        for line in NEps.write_tcl():
            f.write(line)
        f.close()
    
    time_elapsed = (time.clock() - time_start)
    #print("Writing Time {}".format(time_elapsed))
    
    time_start = time.clock()
    
    executable = os.path.join(ghcompfolder,'Alpaca4d\OpenSees-Solvers\opensees.bat')
    #executable = os.path.join(ghcompfolder,'C:\OpenSees\bin\opensees.bat')
    
    #process = subprocess.Popen([r'C:\OpenSees\bin\OpenSees', outputFileName], shell = True, stdout=subprocess.PIPE, stderr=subprocess.PIPE)
    process = subprocess.Popen([executable, outputFileName], shell = True,  stdout=subprocess.PIPE, stderr=subprocess.PIPE)
    stdout, stderr = process.communicate()
    #print(stdout, stderr)
    process.kill()
    
    time_elapsed = (time.clock() - time_start)
    #print("Analyses Time {}".format(time_elapsed))
    #filepath = os.path.join(r'C:\OpenSees\bin',recorderFileName)
    fileObj = open(filepath1, 'r')
    words = fileObj.read().splitlines(" ")
    #print(fileObj.read())
    N = [ float(i.split()[0]) for i in words]
    fileObj.close()
    os.remove(runFileName)
    os.remove(filepath1)
    fileObj = open(filepath2, 'r')
    words = fileObj.read().splitlines(" ")
    #print(fileObj.read())
    Eps = [ float(i.split()[0]) for i in words]
    fileObj.close()
    os.remove(filepath2)
    
    return N
    
if checkData:
    FiberSection.secTag = 1

    for i, item in enumerate(FiberSection.path):
        item.material.matTag = i + 1
        #print(item.material.matTag )
    j = i+2
    for i, item in enumerate(FiberSection.layer):
        item.material.matTag = j + i
        #print(j+i)
        
        
A = ghp.run(RunNEps,[-1.0, 1.0], True)


def linspace(start, stop, len):
    step = (mt.fabs(start)+stop)/(len-1)
    return [start + step*interval for interval in range(len)]
    
print(min(A),max(A))

n1 = int(mt.fabs(min(A)/100))
n2 = int(mt.fabs(max(A)/10))
listP = linspace(min(A), -5.0, n1) + linspace(5, max(A)-10.0, n2)

print(listP)

B = ghp.run(RunMCpositive, listP,False)
C = ghp.run(RunMCnegative, listP,False)

k1, k2, k3 = [], [], []
M1, M2, M3 = [], [], []
Nupos, Nuneg = [], []
M1uP, M2uP, M3uP = [], [], []
M1uN, M2uN, M3uN = [], [], []

for item in B:
    """
    k1.append(item[0])
    k2.append(item[1])
    k3.append(item[2])
    M1.append(item[3])
    M2.append(item[4])
    M3.append(item[5])
    """
    if len(item[4]) != 0:
        Nupos.append(item[3][-1])
        M1uP.append( max(item[4]))
        M2uP.append( max(item[5]))

for item in C:
    """
    k1.append(item[0])
    k2.append(item[1])
    k3.append(item[2])
    M1.append(item[3])
    M2.append(item[4])
    M3.append(item[5])
    """
    if len(item[4]) != 0:
        Nuneg.append(item[3][-1])
        M1uN.append( min(item[4]))
        M2uN.append( min(item[5]))
"""
k1 = th.list_to_tree(k1)
k2 = th.list_to_tree(k2)
k3 = th.list_to_tree(k3)
M1 = th.list_to_tree(M1)
M2 = th.list_to_tree(M2)
M3 = th.list_to_tree(M3)
"""
M1u = M1uN + M1uP[::-1] + M1uN[0:1]
M2u = M2uN + M2uP[::-1] + M2uN[0:1]
N = Nuneg + Nupos[::-1] + Nuneg[0:1]
# ---------- end mnm_3 ----------
panel_14 = Panel(mnm_3.M2u)

mcm_3 = MomentCurvatureModelAlpaca4d(FiberSection=python_2.FiberSection, P=neg_4, alpha=number_slider_7, maxPhi=number_slider_9, nIncr=number_slider_8)  # -> out, script, k1, k2, M1, M2; inputs nIncr: Int32
# ---------- mcm_3: Python ----------
"""
Run an OpenSees Analysis
-
    Args:
        FiberSection:
        P: axial load 
        alpha: angle of local axis rotation  
        maxPhi: Max Curvature
        nIncr: Number of analysis increments
    Returns:
        AlpacaSolvedModel:
"""



import Rhino.RhinoDoc
import Grasshopper as gh
import copy
import rhinoscriptsyntax as rs
import Rhino.Geometry as rg
import os
import time
import sys
import subprocess
import math as mt

__author__ = "Ing. Domenico Gaudioso"
__contact__ = "DomenicoGaudioso@outlook.it"
__version__ = "2021.09.17"

ghenv.Component.Name = "Moment Curvature Model (Alpaca4d)"
ghenv.Component.NickName = 'MCM'
ghenv.Component.Message = "Moment Curvature Model (Alpaca4d)"

ghcompfolder = gh.Folders.DefaultAssemblyFolder
if ghcompfolder not in sys.path:
    sys.path.append(ghcompfolder)

try:
    from Alpaca4d import alpaca4d as alpaca
except:
    msg = "Cannot import Alpaca4d. Is the Alpaca4d folder available in " + ghcompfolder + "?"
    ghenv.Component.AddRuntimeMessage(gh.Kernel.GH_RuntimeMessageLevel.Error, msg)


checkData = True



if not FiberSection:
    checkData = False
    msg = "Input parameter AlpacaModel failed to collect data"
    ghenv.Component.AddRuntimeMessage(gh.Kernel.GH_RuntimeMessageLevel.Warning, msg)
if not P: #
    checkData = False
    msg = "Input parameter P failed to collect data"
    ghenv.Component.AddRuntimeMessage(gh.Kernel.GH_RuntimeMessageLevel.Warning, msg)
    
if not alpha: #
    checkData = False
    msg = "Input parameter alpha failed to collect data"
    ghenv.Component.AddRuntimeMessage(gh.Kernel.GH_RuntimeMessageLevel.Warning, msg)

if not maxPhi: #
    checkData = False
    msg = "Input parameter maxPhi failed to collect data"
    ghenv.Component.AddRuntimeMessage(gh.Kernel.GH_RuntimeMessageLevel.Warning, msg)

if not nIncr: #
    checkData = False
    msg = "Input parameter nIncr failed to collect data"
    ghenv.Component.AddRuntimeMessage(gh.Kernel.GH_RuntimeMessageLevel.Warning, msg)
    


################### ASSEMBLE MODEL ##############################
if checkData:
    FiberSection.secTag = 1
    for i, item in enumerate(FiberSection.path):
        item.material.matTag = 2*(i+1)
        item.material.matTagMinMax = 2*i+1
        #print(item.material.matTag )
    j = i+2
    for i, item in enumerate(FiberSection.layer):
        j = j + i 
        item.material.matTag = 2*(j+1)
        item.material.matTagMinMax = 2*j+1
        #print(j+i)
    w = j+2
    for i, item in enumerate(FiberSection.fiber):
        w = w + i 
        item.material.matTag = 2*(w+1)
        item.material.matTagMinMax = 2*w+1
#################################################################
    MC = alpaca.MomentCurvature(FiberSection, P, alpha, maxPhi, nIncr)

    script = MC.write_tcl()
    #print(script)
    
    outputFileName = 'openSeesSectionModel'
    recorderFileName1 = 'MKsectionForce.out'
    recorderFileName2 = 'MKsectionDef.out'
    
    if checkData:
        FolderPath = rs.DocumentPath()
        os.chdir(FolderPath)
    
        
    for dirpath, dirnames, filenames in os.walk(FolderPath):
        for filename in filenames:
            if filename == outputFileName:
                file = os.path.join(dirpath,outputFileName)
                filepath1 = os.path.join(dirpath,recorderFileName1)
                filepath2 = os.path.join(dirpath,recorderFileName2)
            elif filename == recorderFileName1:
                file1 = os.path.join(dirpath,recorderFileName1)
                file2 = os.path.join(dirpath,recorderFileName2)
                os.remove(file1)
                os.remove(file2)
    
    time_start = time.clock()
    
    with open(outputFileName, 'w') as f:
        for line in MC.write_tcl():
            f.write(line)
        f.close()
    
    time_elapsed = (time.clock() - time_start)
    #print("Writing Time {}".format(time_elapsed))
    
    time_start = time.clock()
    
    executable = os.path.join(ghcompfolder,'Alpaca4d\OpenSees-Solvers\opensees.bat')
    
    #process = subprocess.Popen([r'C:\OpenSees\bin\OpenSees', outputFileName], shell = True, stdout=subprocess.PIPE, stderr=subprocess.PIPE)
    process = subprocess.Popen([executable, outputFileName], shell = True,  stdout=subprocess.PIPE, stderr=subprocess.PIPE)
    stdout, stderr = process.communicate()
    print(stderr)
    process.kill()
    
    time_elapsed = (time.clock() - time_start)
    print("Analyses Time: {} s".format(time_elapsed))
    
    
    
    
    fileObj = open(filepath1, 'r')
    words = fileObj.read().splitlines(" ")
    #N = [ float(i.split()[0]) for i in words]
    M1 = [ float(i.split()[1]) for i in words]
    M2 = [ float(i.split()[2]) for i in words]
    #M3 = [ float(i.split()[3]) for i in words]
    fileObj.close()
    #FiberSection = [k, M]
    
    fileObj = open(filepath2, 'r')
    words = fileObj.read().splitlines(" ")
    #N = [ float(i.split()[0]) for i in words]
    k1 = [ float(i.split()[1]) for i in words]
    k2 = [ float(i.split()[2]) for i in words]
    #k3 = [ float(i.split()[3]) for i in words]
    fileObj.close()
# ---------- end mcm_3 ----------
