# Grasshopper definition SectionNLAlpaca4d2.gh (Grasshopper 1.0.7)
# plug-ins: GH_CPython, Kangaroo2 Components

# ---- group: Section Reinforce Concreate / dimensione Y
number_slider = Slider(0.2, range=0..1)

# ---- group: Section Reinforce Concreate / dimensione X
number_slider_2 = Slider(0.5, range=0..1)

# ---- group: Section Reinforce Concreate / copriferro
number_slider_3 = Slider(0.03, range=0..0.1)

# ---- group: Section Reinforce Concreate / dimensione Y
number_slider_4 = Slider(0.2, range=0..1)

# ---- group: Section Reinforce Concreate / dimensione X
number_slider_5 = Slider(0.6, range=0..1)

# ---- group: Section Reinforce Concreate / copriferro
number_slider_6 = Slider(0.03, range=0..0.1)

# ----
number_slider_7 = Slider(1, range=0..1)

# ---- group: IPE / H
number_slider_8 = Slider(0.33, range=0..1)

# ---- group: IPE
number_slider_9 = Slider(0.0115, range=0..0.1)
number_slider_10 = Slider(0.16, range=0..1)
cluster = Cluster_2(
    bsup=number_slider_10,
    tsup=number_slider_9,
    tw=Slider(0.0075, range=0..0.01),
    H=number_slider_8,
    binf=number_slider_10,
    tinf=number_slider_9)

# ----
number_slider_11 = Slider(0.3, range=0..1)

# ---- group: RHS
number_slider_12 = Slider(0.006, range=0..0.01)
number_slider_13 = Slider(0.2, range=0..1)
cluster_2 = Cluster_3(B=Slider(0.2, range=0..1), tb=number_slider_12, H=Slider(0.2, range=0..10), th=number_slider_12)

# ----
num = Number("500/1.15")
num_2 = Number("-20/1.0")
multiplication = Multiplication(A=num, B=1000)
panel = Panel("-0.0035")
panel_2 = Panel("392.1")
toggle = BooleanToggle(False)
number_slider_14 = Slider(2, range=0..10)

# ---- group: Section Reinforce Concreate
cluster_3 = Cluster(x_dimension=number_slider_2, y_dimension=Slider(0.5, range=0..1), cover=number_slider_3)  # -> polyc_2, line_2

# ----
multiplication_2 = Multiplication(A=num_2, B=1000)
multiplication_3 = Multiplication(A=num_2, B=1000)
multiplication_4 = Multiplication(A="1000.00", B=1000)

# ---- group: Section Reinforce Concreate
cluster_4 = Cluster(x_dimension=number_slider_5, y_dimension=number_slider_7, cover=number_slider_6)  # -> polyc_2, line_2

# ----
srf = Surface(cluster)
multiplication_5 = Multiplication(A="469.56", B=1000)
multiplication_6 = Multiplication(A="3.0", B=1000)
join = BrepJoin(Breps=flatten(srf))  # -> Breps, Closed
division = Division(A=number_slider_7, B=number_slider_14)
division_2 = Division(A=number_slider_8, B=number_slider_14)
fmerge = MergeFaces(Brep=join.Breps)  # -> Breps, Before, After
python = GhPythonScript()  # -> Out, A
addition = Addition(A=division, B=division_2)
neg = Negative(Value=Slider(0.03, range=0..0.1))
split = SplitBrep(Brep=cluster_3.polyc_2, Cutter=flatten(fmerge.Breps))  # -> flatten(Result)
number_slider_15 = Slider(75, range=0..100)
debrep = DeconstructBrep(Brep=fmerge.Breps)  # -> Faces, Edges, Vertices
number_slider_16 = Slider(2, range=0..10)
offset = OffsetCurve(Curve=cluster_2, Distance=neg, Plane=PlaneXY(0, 0, 0), Corners=1)  # -> flatten(Curve)
Y = UnitY(Factor=addition)
item = ListItem(List=cluster_4.line_2, Index=0, Wrap=True)  # -> Item, Item1, Item2, Item3
item_2 = ListItem(List=split, Index=Slider(1, range=0..10), Wrap=True)
explode = Explode(Curve=offset, Recursive=True)  # -> flatten(Segments), Vertices
move = Move(Geometry=cluster_4.polyc_2, Motion=Y)  # -> Geometry, Transform
xz = XZPlane(Origin=Point(0, 0, 0))
Y_2 = UnitY(Factor=number_slider_8)  # -> expr("-x", UnitVector)
crv = Curve([item.Item, item.Item2])
item_3 = ListItem(List=explode.Segments, Index=0, Wrap=True)  # -> Item, Item1, Item2, Item3, Item4, Item5, Item6, Item7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
qrsettings = QuadRemeshSettings(
    TargetCount=Slider(200, range=0..1000),
    AdaptiveSize=0,
    AdaptiveCount=False,
    HardEdges=False,
    SeamEdges=0,
    Symmetry=0,
    GuideCurves=0)
merge = Merge(Data1=cluster, Data2=move.Geometry)
qrmesh = QuadRemesh(Mesh=item_2, Settings=qrsettings)
crv_2 = Curve([item_3.Item, item_3.Item2, item_3.Item9, item_3.Item11, item_3.Item13, item_3.Item15, item_3.Item4, item_3.Item6])
X = Panel("""0.423
0.5
0.577
0.654
0.808
0.934
1.06
1.186
1.174
1.3
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""")
Y_3 = Panel("""0.278
0.338
0.397
0.457
0.448
0.325
0.201
0.078
0.078
0.201
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""")
number_slider_17 = Slider(100, range=0..100)
X_2 = Panel("""0.42
0.73
1.18
1.63
1.94
2.36
1.85
1.72
1.18
0.64
0.51
0
0.42""")
Y_4 = Panel("""0.2
0.44
0
0.44
0.2
0.705
1.15
1
1.5
1
1.15
0.705
0.2""")
item_4 = ListItem(List=cluster_2, Index=0, Wrap=True)  # -> Item, Item1, Item2, Item3
move_2 = Move(Geometry=merge, Motion=Y)  # -> Geometry, Transform
qrsettings_2 = QuadRemeshSettings(
    TargetCount=Slider(60, range=0..100),
    AdaptiveSize=0,
    AdaptiveCount=False,
    HardEdges=False,
    SeamEdges=0,
    Symmetry=0,
    GuideCurves=0)
qrsettings_3 = QuadRemeshSettings(
    TargetCount=Slider(1000, range=0..1000),
    AdaptiveSize=0,
    AdaptiveCount=False,
    HardEdges=False,
    SeamEdges=0,
    Symmetry=0,
    GuideCurves=0)
pt = ConstructPoint(XCoordinate=X, YCoordinate=Y_3, ZCoordinate=0)
pt_2 = ConstructPoint(XCoordinate=X_2, YCoordinate=Y_4, ZCoordinate=0)
neg_2 = Negative(Value=Slider(0.02, range=0..0.1))
crv_3 = Curve([item_4.Item, item_4.Item1])
item_5 = ListItem(List=move_2.Geometry, Index=0, Wrap=True)  # -> Item, Item1, Item2, Item3
rotate = Rotate(Geometry=cluster, Angle=1.570796327, Plane=PlaneXY(0, 0, 0))  # -> Geometry, Transform
offset_2 = OffsetCurve(Curve=move.Geometry, Distance=neg_2, Plane=PlaneXY(0, 0, 0), Corners=1)
crv_4 = Curve(item_5.Item3)
pline = PolyLine(Vertices=pt_2, Closed=False)
area = Area(Geometry=pline)  # -> Area, Centroid
neg_3 = Negative(Value=area.Centroid)
move_3 = Move(Geometry=pline, Motion=neg_3)  # -> Geometry, Transform
crv_5 = Curve([item_5.Item, item_5.Item1, item_5.Item2])
explode_2 = Explode(Curve=offset_2, Recursive=True)  # -> Segments, Vertices
crv_6 = Curve([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])
item_6 = ListItem(List=explode_2.Segments, Index=0, Wrap=True)  # -> Item, Item1, Item2
neg_4 = Negative(Value=Slider(0.03, range=0..0.1))
qrmesh_2 = QuadRemesh(Mesh=move_3.Geometry, Settings=qrsettings_2)
item_7 = ListItem(List=crv_6, Index=0, Wrap=True)  # -> Item, Item1, Item2, Item3
crv_7 = Curve([item_6.Item, item_6.Item2])
qrmesh_3 = QuadRemesh(Mesh=move_3.Geometry, Settings=qrsettings_3)
explode_3 = Explode(Curve=move_3.Geometry, Recursive=True)  # -> Segments, Vertices
offset_3 = OffsetCurve(Curve=move_3.Geometry, Distance=neg_4, Plane=PlaneXY(0, 0, 0), Corners=1)
explode_4 = Explode(Curve=offset_3, Recursive=True)  # -> Segments, Vertices
md = MeshDirection(Mesh=qrmesh_2)
faceb = FaceBoundaries(Mesh=md)
faceb_2 = FaceBoundaries(Mesh=qrmesh_3)
area_2 = Area(Geometry=faceb)  # -> Area, Centroid
explode_5 = Explode(Curve=faceb, Recursive=True)  # -> Segments, Vertices
crv_8 = Curve(<curve referenced from the Rhino model>)
offset_4 = OffsetCurve(Curve=explode_3.Segments, Distance=neg_4, Plane=PlaneXY(0, 0, 0), Corners=1)
area_3 = Area(Geometry=faceb_2)  # -> Area, Centroid
xy = XYPlane(Origin=area_2.Centroid)
cull_i = CullIndex(List=explode_5.Vertices, Indices=Slider(4, range=0..10), Wrap=True)
number_slider_18 = Slider(0.8, range=0..1)
area_4 = Area(Geometry=move.Geometry)  # -> Area, Centroid
fcircle = CircleFit(Points=cull_i)  # -> Circle, Radius, Deviation
Y_5 = UnitY(Factor=Slider(4, range=0..10))
alongcrv = SortAlongCurve(Points=cull_i, Curve=fcircle.Circle)  # -> Points, Indices
move_4 = Move(Geometry=area_4.Centroid, Motion=Y_5)  # -> Geometry, Transform
pline_2 = PolyLine(Vertices=alongcrv.Points, Closed=Toggle(True))  # -> flatten(Polyline)
number_slider_19 = Slider(10000, range=0..10000)
number_slider_20 = Slider(96, range=0..100)
number_slider_21 = Slider(30, range=0..100)
number_slider_22 = Slider(10, range=0..10)
number_slider_23 = Slider(10, range=0..10)
neg_5 = Negative(Value=Slider(200, range=0..1000))
neg_6 = Negative(Value=Slider(150, range=0..1000))
mnm = MNModelAlpaca4d()  # -> out, N, M; inputs nPoint: Int32
# ---------- mnm: Python ----------
"""
Run an OpenSees Analysis
-
    Args:
        FiberSection:
        direction: 1 for M2 and 2 for M1. Default is 1 
        nPoint: number of Point for make de N-M domain
    Returns:
        N: axial load valor
        M: bending moment valor
"""



import Rhino.RhinoDoc
import Grasshopper as gh
import copy
import rhinoscriptsyntax as rs
import Rhino.Geometry as rg
import os
import time
import sys
import subprocess
import ghpythonlib.treehelpers as th
import math as mt
import ghpythonlib.parallel as ghp


__author__ = "Ing. Domenico Gaudioso"
__contact__ = "DomenicoGaudioso@outlook.it"
__version__ = "2021.09.17"

ghenv.Component.Name = "M-N Model (Alpaca4d)"
ghenv.Component.NickName = 'MNM'
ghenv.Component.Message = "M-N Model (Alpaca4d)"

ghcompfolder = gh.Folders.DefaultAssemblyFolder
if ghcompfolder not in sys.path:
    sys.path.append(ghcompfolder)

try:
    from Alpaca4d import alpaca4d as alpaca
except:
    msg = "Cannot import Alpaca4d. Is the Alpaca4d folder available in " + ghcompfolder + "?"
    ghenv.Component.AddRuntimeMessage(gh.Kernel.GH_RuntimeMessageLevel.Error, msg)


checkData = True


if not FiberSection:
    checkData = False
    msg = "Input parameter AlpacaModel failed to collect data"
    ghenv.Component.AddRuntimeMessage(gh.Kernel.GH_RuntimeMessageLevel.Warning, msg)
    
if direction == None:
    direction = 1
    
def linspace(start, stop, len):
    step = (mt.fabs(start)+stop)/(len-1)
    return [start + step*interval for interval in range(len)]
        
def RunMCpositive(Pi): 
    if Pi > 0.0:
        recorderFileName = "MKsectionP{}positiveMpositive".format(int(mt.fabs(Pi)))
        outputFileName = "OSSModel{}positiveMpositive".format(int(mt.fabs(Pi)))
    elif Pi < 0.0:
        recorderFileName = "MKsectionP{}negativeMpositive".format(int(mt.fabs(Pi)))
        outputFileName = "OSSModel{}negativeMpositive".format(int(mt.fabs(Pi)))
        
    if direction == 1:
        alpha = 0.0
    else:
        alpha = 90.0
            
    MC = alpaca.MomentCurvature(recorderFileName,FiberSection, float(Pi), alpha, 2.0, 1000) #mu*FiberSection.Ky
    script = MC.write_tcl()
    
    FolderPath = rs.DocumentPath()
    os.chdir(FolderPath)
        
    recorderFileName1 = recorderFileName + "Force" + ".out"
    recorderFileName2 = recorderFileName + "Disp" + ".out"
    
    runFileName = os.path.join(FolderPath,outputFileName)
    filepath1 = os.path.join(FolderPath,recorderFileName1)
    #filepath2 = os.path.join(FolderPath,recorderFileName2)
    """
    if os.path.exists(runFileName):
      os.remove(runFileName)
      os.remove(filepath1)
      os.remove(filepath1)
    else:
      print("The file does not exist")
    """
    time_start = time.clock()
    
    with open(outputFileName, 'w') as f:
        for line in MC.write_tcl():
            f.write(line)
        f.close()
    
    time_elapsed = (time.clock() - time_start)
    #print("Writing Time {}".format(time_elapsed))
    
    time_start = time.clock()
    
    executable = os.path.join(ghcompfolder,'Alpaca4d\OpenSees-Solvers\opensees.bat')
    #executable = os.path.join(ghcompfolder,'C:\OpenSees\bin\opensees.bat')
    
    #process = subprocess.Popen([r'C:\OpenSees\bin\OpenSees', outputFileName], shell = True, stdout=subprocess.PIPE, stderr=subprocess.PIPE)
    process = subprocess.Popen([executable, outputFileName], shell = True,  stdout=subprocess.PIPE, stderr=subprocess.PIPE)
    stdout, stderr = process.communicate()
    #print(stdout, stderr)
    process.kill()
    os.remove(runFileName)
    time_elapsed = (time.clock() - time_start)
    #print("Analyses Time {}".format(time_elapsed))
    #filepath = os.path.join(r'C:\OpenSees\bin',recorderFileName)
    fileObj = open(filepath1, 'r')
    words = fileObj.read().splitlines(" ")
    #print(fileObj.read())
    N = "None"
    if len(words) != 0:
        N = float(words[-1].split()[0])
        M1 = float(words[-1].split()[1])
        M2 = float(words[-1].split()[2])
    fileObj.close()

    os.remove(filepath1)
    """
    fileObj = open(filepath2, 'r')
    words = fileObj.read().splitlines(" ")
    #print(fileObj.read())

    k1 = [ float(i.split()[1]) for i in words]
    k2 = [ float(i.split()[2]) for i in words]
    k3 = [ float(i.split()[3]) for i in words]
    fileObj.close()
    """
    #os.remove(filepath2)
    if N != "None" :
        return [N, M1, M2]


def RunMCnegative(Pi): 

    if Pi > 0.0:
        recorderFileName = "MKsectionP{}positiveMnegative".format(int(mt.fabs(Pi)))
        outputFileName = "OSSModel{}positiveMnegative".format(int(mt.fabs(Pi)))
    elif Pi < 0.0:
        recorderFileName = "MKsectionP{}negativeMnegative".format(int(mt.fabs(Pi)))
        outputFileName = "OSSModel{}negativeMnegative".format(int(mt.fabs(Pi)))
        
    if direction == 1:
        alpha = 180.00
    else:
        alpha = 270.00
            
    MC = alpaca.MomentCurvature(recorderFileName,FiberSection, float(Pi), alpha, 2.0, 1000)
    script = MC.write_tcl()
    
    FolderPath = rs.DocumentPath()
    os.chdir(FolderPath)
        
    recorderFileName1 = recorderFileName + "Force" + ".out"
    recorderFileName2 = recorderFileName + "Disp" + ".out"
    
    runFileName = os.path.join(FolderPath,outputFileName)
    filepath1 = os.path.join(FolderPath,recorderFileName1)
    #filepath2 = os.path.join(FolderPath,recorderFileName2)
    """
    if os.path.exists(runFileName):
      os.remove(runFileName)
      os.remove(filepath1)
      os.remove(filepath1)
    else:
      print("The file does not exist")
      """
    time_start = time.clock()
    
    with open(outputFileName, 'w') as f:
        for line in MC.write_tcl():
            f.write(line)
        f.close()
    
    time_elapsed = (time.clock() - time_start)
    #print("Writing Time {}".format(time_elapsed))
    
    time_start = time.clock()
    
    executable = os.path.join(ghcompfolder,'Alpaca4d\OpenSees-Solvers\opensees.bat')
    #executable = os.path.join(ghcompfolder,'C:\OpenSees\bin\opensees.bat')
    
    #process = subprocess.Popen([r'C:\OpenSees\bin\OpenSees', outputFileName], shell = True, stdout=subprocess.PIPE, stderr=subprocess.PIPE)
    process = subprocess.Popen([executable, outputFileName], shell = True,  stdout=subprocess.PIPE, stderr=subprocess.PIPE)
    stdout, stderr = process.communicate()
    #print(stdout, stderr)
    process.kill()
    os.remove(runFileName)
    time_elapsed = (time.clock() - time_start)
    #print("Analyses Time {}".format(time_elapsed))
    #filepath = os.path.join(r'C:\OpenSees\bin',recorderFileName)
    fileObj = open(filepath1, 'r')
    words = fileObj.read().splitlines(" ")
    #print(fileObj.read())
    N = "None"
    if len(words) != 0:
        N = float(words[-1].split()[0])
        M1 = float(words[-1].split()[1])
        M2 = float(words[-1].split()[2])
    fileObj.close()

    os.remove(filepath1)
    """
    fileObj = open(filepath2, 'r')
    words = fileObj.read().splitlines(" ")
    #print(fileObj.read())

    k1 = [ float(i.split()[1]) for i in words]
    k2 = [ float(i.split()[2]) for i in words]
    k3 = [ float(i.split()[3]) for i in words]
    fileObj.close()
    """
    #os.remove(filepath2)
    if N != "None" :
        return [N, M1, M2]
        
        

if checkData:
    centerForce = rg.Point3d(FiberSection.centerSection.X, FiberSection.centerSection.Y, FiberSection.centerSection.Z)
### ASSEMBLE ###
    FiberSection.secTag = 1
    for i, item in enumerate(FiberSection.path):
        item.material.matTag = 2*(i+1)
        item.material.matTagMinMax = 2*i+1
        #print(item.material.matTag )
    j = i+2
    for i, item in enumerate(FiberSection.layer):
        j = j + i 
        item.material.matTag = 2*(j+1)
        item.material.matTagMinMax = 2*j+1
        #print(j+i)
    w = j+2
    for i, item in enumerate(FiberSection.fiber):
        w = w + i 
        item.material.matTag = 2*(w+1)
        item.material.matTagMinMax = 2*w+1
        
#A = ghp.run(RunNEps,[-1.0, 1.0], True)

        
    print(FiberSection.NultNeg+0.1*FiberSection.NultNeg,FiberSection.NultPos)
    
    
    #n1 = int(mt.fabs(min(A)/stepValorPositive))
    #n2 = int(mt.fabs(max(A)/stepValorNegative))
    
    #listP = linspace(min(A), -5.0, n1) + linspace(5, max(A)-10.0, n2)
    
    if nPoint == None:
        nPoint = 10
        
    listP = linspace(FiberSection.NultNeg,FiberSection.NultPos, nPoint)
    
    
    B = ghp.run(RunMCpositive, listP,False)
    C = ghp.run(RunMCnegative, listP,False)
    
    #print(D[7])
    #RunM1Cpositive(Pi): 
    
    
    Nupos, Nuneg = [], []
    M1uP, M2uP = [], []
    M1uN, M2uN = [], []
    
    B =filter(None, B) #elimino il None
    C =filter(None, C) 
    
    for item in B:
        Nupos.append(item[0])
        M1uP.append( item[1])
        M2uP.append( item[2])
        #M3uP.append( item[3])
        
    for item in C:
        Nuneg.append(item[0])
        M1uN.append( item[1])
        M2uN.append( item[2])
    
    M1 = M1uN + M1uP[::-1] + M1uN[0:1]
    M2 = M2uN + M2uP[::-1] + M2uN[0:1]
    N = Nuneg + Nupos[::-1] + Nuneg[0:1]
    
    if direction == 1:
        M = M2
    else:
        M = M1
# ---------- end mnm ----------
dm1m2 = DomainM1M2Alpaca4d()  # -> out, N, M1, M2; inputs nPoint: Int32
# ---------- dm1m2: Python ----------
"""
Run an OpenSees Analysis
-
    Args:
        FiberSection:
        direction: 1 for M2 and 2 for M1. Default is 1 
        nPoint: number of Point for make de N-M domain
    Returns:
        N: axial load valor
        M: bending moment valor
"""



import Rhino.RhinoDoc
import Grasshopper as gh
import copy
import rhinoscriptsyntax as rs
import Rhino.Geometry as rg
import os
import time
import sys
import subprocess
import ghpythonlib.treehelpers as th
import math as mt
import ghpythonlib.parallel as ghp


__author__ = "Ing. Domenico Gaudioso"
__contact__ = "DomenicoGaudioso@outlook.it"
__version__ = "2021.09.17"

ghenv.Component.Name = "Domain M1 M2 (Alpaca4d)"
ghenv.Component.NickName = 'DM1M2'
ghenv.Component.Message = "Domain M1 M2 (Alpaca4d)"

ghcompfolder = gh.Folders.DefaultAssemblyFolder
if ghcompfolder not in sys.path:
    sys.path.append(ghcompfolder)

try:
    from Alpaca4d import alpaca4d as alpaca
except:
    msg = "Cannot import Alpaca4d. Is the Alpaca4d folder available in " + ghcompfolder + "?"
    ghenv.Component.AddRuntimeMessage(gh.Kernel.GH_RuntimeMessageLevel.Error, msg)


checkData = True

if not FiberSection:
    checkData = False
    msg = "Input parameter AlpacaModel failed to collect data"
    ghenv.Component.AddRuntimeMessage(gh.Kernel.GH_RuntimeMessageLevel.Warning, msg)


def linspace(start, stop, len):
    step = (mt.fabs(start)+stop)/(len-1)
    return [start + step*interval for interval in range(len)]


def RunMCpositive(Pi): 
    if Pi > 0.0:
        recorderFileName = "MKsectionP{}positiveMpositive".format(int(mt.fabs(Pi)))
        outputFileName = "OSSModel{}positiveMpositive".format(int(mt.fabs(Pi)))
    elif Pi < 0.0:
        recorderFileName = "MKsectionP{}negativeMpositive".format(int(mt.fabs(Pi)))
        outputFileName = "OSSModel{}negativeMpositive".format(int(mt.fabs(Pi)))
    
    if nPoint == None:
        alpha = linspace(0,360, 36)
    else :
        alpha = linspace(0,360, nPoint)
   
        
    listN = []
    listM1 = []
    listM2 = []
    for alphai in alpha:
        MC = alpaca.MomentCurvature(recorderFileName,FiberSection, float(Pi), alphai, 2.0, 1000) #mu*FiberSection.Ky
        script = MC.write_tcl()
    
        FolderPath = rs.DocumentPath()
        os.chdir(FolderPath)
        
        recorderFileName1 = recorderFileName + "Force" + ".out"
        recorderFileName2 = recorderFileName + "Disp" + ".out"
    
        runFileName = os.path.join(FolderPath,outputFileName)
        filepath1 = os.path.join(FolderPath,recorderFileName1)
        #filepath2 = os.path.join(FolderPath,recorderFileName2)
        time_start = time.clock()
    
        with open(outputFileName, 'w') as f:
            for line in MC.write_tcl():
                f.write(line)
            f.close()
    
        time_elapsed = (time.clock() - time_start)
        #print("Writing Time {}".format(time_elapsed))
        
        time_start = time.clock()
        
        executable = os.path.join(ghcompfolder,'Alpaca4d\OpenSees-Solvers\opensees.bat')
        #executable = os.path.join(ghcompfolder,'C:\OpenSees\bin\opensees.bat')
        
        #process = subprocess.Popen([r'C:\OpenSees\bin\OpenSees', outputFileName], shell = True, stdout=subprocess.PIPE, stderr=subprocess.PIPE)
        process = subprocess.Popen([executable, outputFileName], shell = True,  stdout=subprocess.PIPE, stderr=subprocess.PIPE)
        stdout, stderr = process.communicate()
        #print(stdout, stderr)
        process.kill()
        os.remove(runFileName)
        time_elapsed = (time.clock() - time_start)
        #print("Analyses Time {}".format(time_elapsed))
        #filepath = os.path.join(r'C:\OpenSees\bin',recorderFileName)
        fileObj = open(filepath1, 'r')
        words = fileObj.read().splitlines(" ")
        #print(fileObj.read())
        N = "None"
        if len(words) != 0:
            N = float(words[-1].split()[0])
            M1 = float(words[-1].split()[1])
            M2 = float(words[-1].split()[2])
            
            listN.append(N)
            listM1.append(M1)
            listM2.append(M2)
        fileObj.close()

        os.remove(filepath1)
    """
    fileObj = open(filepath2, 'r')
    words = fileObj.read().splitlines(" ")
    #print(fileObj.read())

    k1 = [ float(i.split()[1]) for i in words]
    k2 = [ float(i.split()[2]) for i in words]
    k3 = [ float(i.split()[3]) for i in words]
    fileObj.close()
    """
        #os.remove(filepath2)
    if N != "None" :
        return [listN, listM1, listM2]


        
if checkData:
    FiberSection.secTag = 1
    for i, item in enumerate(FiberSection.path):
        item.material.matTag = 2*(i+1)
        item.material.matTagMinMax = 2*i+1
        #print(item.material.matTag )
    j = i+2
    for i, item in enumerate(FiberSection.layer):
        j = j + i 
        item.material.matTag = 2*(j+1)
        item.material.matTagMinMax = 2*j+1
        #print(j+i)
    w = j+2
    for i, item in enumerate(FiberSection.fiber):
        w = w + i 
        item.material.matTag = 2*(w+1)
        item.material.matTagMinMax = 2*w+1
        
    #A = ghp.run(RunNEps,[-1.0, 1.0], True)
    
    
    
        
    print(FiberSection.NultNeg+0.1*FiberSection.NultNeg,FiberSection.NultPos)
    
    
    #n1 = int(mt.fabs(min(A)/stepValorPositive))
    #n2 = int(mt.fabs(max(A)/stepValorNegative))
    
    #listP = linspace(min(A), -5.0, n1) + linspace(5, max(A)-10.0, n2)
    
    
    if axialLoad == None:
        axialLoad = 0.1
    B = ghp.run(RunMCpositive, [axialLoad],False)
    B =filter(None, B)
    #C = ghp.run(RunMCnegative, listP,False)
    
    #print(B[1])
    #RunM1Cpositive(Pi): 
    
    N, M1, M2 = [], [], []
    
    for item in B:
        #item =filter(None, item) #elimino il None
        N.append(item[0])
        M1.append(item[1])
        M2.append(item[2])
    
    
    N, M1, M2 = th.list_to_tree(N), th.list_to_tree(M1), th.list_to_tree(M2)
    
    
    
    """
    for item in B:
        Nupos.append(item[0])
        M1uP.append( item[1])
        M2uP.append( item[2])
        #M3uP.append( item[3])
        
    for item in C:
        Nuneg.append(item[0])
        M1uN.append( item[1])
        M2uN.append( item[2])
    
    M1 = M1uN + M1uP[::-1] + M1uN[0:1]
    M2 = M2uN + M2uP[::-1] + M2uN[0:1]
    N = Nuneg + Nupos[::-1] + Nuneg[0:1]
    
    if direction == 1:
        M = M2
    else:
        M = M1
    """
# ---------- end dm1m2 ----------
_3dd = _3DDomainAlpaca4d(nPoint=number_slider_22)  # -> out, N, M1, M2; inputs nPoint: Int32
# ---------- _3dd: Python ----------
"""
Run an OpenSees Analysis
-
    Args:
        FiberSection:
        direction: 1 for M2 and 2 for M1. Default is 1 
        nPoint: number of Point for make de N-M domain
    Returns:
        N: axial load valor
        M: bending moment valor
"""



import Rhino.RhinoDoc
import Grasshopper as gh
import copy
import rhinoscriptsyntax as rs
import Rhino.Geometry as rg
import os
import time
import sys
import subprocess
import ghpythonlib.treehelpers as th
import math as mt
import ghpythonlib.parallel as ghp



ghenv.Component.Name = "3D Domain (Alpaca4d)"
ghenv.Component.NickName = '3DD'
ghenv.Component.Message = "3D Domain (Alpaca4d)"

ghcompfolder = gh.Folders.DefaultAssemblyFolder
if ghcompfolder not in sys.path:
    sys.path.append(ghcompfolder)

try:
    from Alpaca4d import alpaca4d as alpaca
except:
    msg = "Cannot import Alpaca4d. Is the Alpaca4d folder available in " + ghcompfolder + "?"
    ghenv.Component.AddRuntimeMessage(gh.Kernel.GH_RuntimeMessageLevel.Error, msg)


checkData = True



if not FiberSection:
    checkData = False
    msg = "Input parameter AlpacaModel failed to collect data"
    ghenv.Component.AddRuntimeMessage(gh.Kernel.GH_RuntimeMessageLevel.Warning, msg)


"""
class MomentCurvature(object):
    def __init__(self, recorderName, section, axialLoad, valorMfix, direction, maxPhi, cForce, numIncr=100):
        #^ y
        #|
        #|
        #|------> x
        self.recorderName = recorderName
        self.section = section
        self.axialLoad = axialLoad
        self.valorMfix = valorMfix
        self.direction = direction
        self.maxPhi = maxPhi
        self.cForce = cForce
        self.numIncr= numIncr
        # Compute curvature increment
        #self.dK = self.maxK / self.numIncr
        self.secTag = 1
        

    def ToString(self):
        return self.write_tcl()

    def write_tcl(self):
        # Define two nodes at (0,0)
        clean = "wipe\n"
        model = "model BasicBuilder -ndm 3 -ndf 6\n"
        
        materialFiber = ''.join([ i.material.write_tcl() for i in self.section.fiber ])
        materialPath = ''.join([ i.material.write_tcl() for i in self.section.path ])
        materialLayer = ''.join([ i.material.write_tcl() for i in self.section.layer ])
        material = materialFiber + materialPath + materialLayer
        
        section = self.section.ToString()
        node1 = "node {} {} {} {}\n".format(1, self.cForce.X, self.cForce.Y, self.cForce.Z)
        node2 = "node {} {} {} {}\n".format(2, self.cForce.X, self.cForce.Y, self.cForce.Z)
        # Fix all degrees of freedom except axial and bending
        fix1 = "fix {} {} {} {} {} {} {}\n".format(1, 1, 1, 1, 1 ,1, 1) #node tag Fx Fy Fz Mx My Mz
        fix2 = "fix {} {} {} {} {} {} {}\n".format(2, 0, 1, 1, 1, 0, 0) #node tag Fx Fy Fz Mx My Mz
        # Define element
        ele = "element zeroLengthSection {} {} {} {}\n".format( 1, 1, 2, self.secTag) #-orient 1 0 0 1 0 0
        # Define constant axial load
        pattern = 'pattern Plain {} "{}" {}\n'.format( 1, 'Constant', "{;")   
        load = "load {} {} {} {} {} {} {};\n".format(2, self.axialLoad, 0.0, 0.0, 0.0, 0.0, 0.0) +  "}\n" 
        # analysis for constant axial load
        Integrator = "integrator LoadControl {}\n".format( 0.1)
        System = "system BandGeneral\n" #-piv
        Test = "test NormUnbalance {} {}\n".format( 1e-10, 1000)
        number = "numberer RCM\n"
        constraints = "constraints Plain\n"
        algorithm = "algorithm Newton\n"
        analysis = "analysis Static\n"
        # Do one analysis for constant axial load
        analyze = "analyze {}\n".format(10) 
        lC = "loadConst -time 0.0\n"
        # Define reference moment 
        recorderName1 = self.recorderName + "Force" + ".out"
        recorderName2 = self.recorderName + "Disp" + ".out"
        recorder1 = "recorder Element -file {} -ele 1 section force\n".format(recorderName1)
        #recorder2 = "recorder Element -file {} -ele 1 section deformation\n".format(recorderName2)
        patternM = 'pattern Plain {} "{}" {}\n'.format( 2, 'Linear', "{;")   
        # Use displacement control at node 2 for section analysis
        #IntegratorD = "integrator DisplacementControl {} {} {} {} {} {}\n".format(2,3,0.00035,1,self.dK,self.dK)
        if self.direction == 1 and self.maxPhi >0:
            directionID = 5
            loadM = "load {} {} {} {} {} {} {};\n".format(2, 0.0, 0.0, 0.0, 0.0, self.direction, self.valorMfix) +  "}\n"
            
        elif self.direction == 2 and self.maxPhi >0:
            directionID = 6
            loadM = "load {} {} {} {} {} {} {};\n".format(2, 0.0, 0.0, 0.0, 0.0, self.valorMfix, self.direction) +  "}\n" 
            
        elif self.direction == 1 and self.maxPhi <0:
            directionID = 5
            loadM = "load {} {} {} {} {} {} {};\n".format(2, 0.0, 0.0, 0.0, 0.0, -self.direction, self.valorMfix) +  "}\n" 
            
        elif self.direction == 2 and self.maxPhi <0:
            directionID = 6
            loadM = "load {} {} {} {} {} {} {};\n".format(2, 0.0, 0.0, 0.0, 0.0, self.valorMfix, -self.direction) +  "}\n" 
            
        IntegratorD = "integrator DisplacementControl {} {} {} {}\n".format(2,directionID,self.maxPhi/self.numIncr, 100) #node dof incr numIter
        #IntegratorD = 'integrator ' + self.Integrator.ToString() + "\n"
        analyze2 = "analyze {}\n".format(self.numIncr) + "\n" + "wipe"+ "\n"

        analyze2 = "set ok [analyze {}]\n".format(self.numIncr) #+ "\n" + "wipe"+ "\n"
        A = "set IDctrlNode 2\n" 
        B = "set IDctrlDOF 6\n"
        C = "set Dmax {}\n".format(self.maxPhi)
        D = "set Dincr {}\n".format(self.maxPhi/self.numIncr)
        E = "set TolStatic {}\n".format(1.e-9)
        F = "set testTypeStatic EnergyIncr \n"
        G = "set maxNumIterStatic {}\n".format(11)
        H = "set algorithmTypeStatic Newton\n"
        #source = "wipe\n"
        source = "source C:/Users/Domen/Desktop/Alpaca MC/aaa.txt\n"

        #return clean + model + material + section +  node1 + node2 + fix1 + fix2 + ele + pattern + load + Integrator + System + Test + number + constraints + algorithm + analysis + analyze +lC + recorder1 + patternM + loadM + IntegratorD + analyze2 + A + B + C + D + E + F + G + H + source
        return clean + model + material + section +  node1 + node2 + fix1 + fix2 + ele + pattern + load + Integrator + System + Test + number + constraints + algorithm + analysis + analyze +lC + recorder1 + patternM + loadM + IntegratorD + analyze2


    def write_py(self):
        # Define two nodes at (0,0)


        return node1 + node2 + fix1 + fix2 + ele  + timeSeries + pattern + load + Integrator + System + test + number + constraints + algorithm + analysis + analyze + timeSeriesM + patternM + loadM + IntegratorD + analyze2
"""
def linspace(start, stop, len):
    step = (mt.fabs(start)+stop)/(len-1)
    return [start + step*interval for interval in range(len)]
    
class MomentCurvature(object):
    def __init__(self, recorderName, section, axialLoad, alpha, maxPhi, numIncr=100):
        #^ y
        #|
        #|
        #|------> x
        self.recorderName = recorderName
        self.section = section
        self.axialLoad = axialLoad
        self.alpha = mt.radians(alpha)
        self.maxPhi = maxPhi
        self.numIncr= numIncr
        # Compute curvature increment
        #self.dK = self.maxK / self.numIncr
        self.secTag = 1
        

    def ToString(self):
        return self.write_tcl()

    def write_tcl(self):
        # Define two nodes at (0,0)
        clean = "wipe\n"
        model = "model BasicBuilder -ndm 3 -ndf 6\n"
        
        materialFiber = ''.join([ i.material.write_tcl() for i in self.section.fiber ])
        materialPath = ''.join([ i.material.write_tcl() for i in self.section.path ])
        materialLayer = ''.join([ i.material.write_tcl() for i in self.section.layer ])
        material = materialFiber + materialPath + materialLayer
        
        section = self.section.ToString()
        node1 = "node {} {} {} {}\n".format(1, self.section.centerSection.X, self.section.centerSection.Y, self.section.centerSection.Z)
        node2 = "node {} {} {} {}\n".format(2, self.section.centerSection.X, self.section.centerSection.Y, self.section.centerSection.Z)
        # Fix all degrees of freedom except axial and bending
        fix1 = "fix {} {} {} {} {} {} {}\n".format(1, 1, 1, 1, 1 ,1, 1) #node tag Fx Fy Fz Mx My Mz
        fix2 = "fix {} {} {} {} {} {} {}\n".format(2, 0, 1, 1, 1, 0, 0) #node tag Fx Fy Fz Mx My Mz
        # Define element
        ele = "element zeroLengthSection {} {} {} {} -orient 1 0 0 0 {} {}\n".format( 1, 1, 2, self.secTag, mt.cos(self.alpha), mt.sin(self.alpha)) #-orient 1 0 0 0 $cos $sin
        # Define constant axial load
        pattern = 'pattern Plain {} "{}" {}\n'.format( 1, 'Constant', "{;")   
        load = "load {} {} {} {} {} {} {};\n".format(2, self.axialLoad, 0.0, 0.0, 0.0, 0.0, 0.0) +  "}\n" 
        # analysis for constant axial load
        Integrator = "integrator LoadControl {}\n".format( 0.1)
        System = "system BandGeneral\n" #-piv
        Test = "test NormUnbalance {} {}\n".format( 1e-10, 1000)
        number = "numberer RCM\n"
        constraints = "constraints Plain\n"
        algorithm = "algorithm Newton\n"
        analysis = "analysis Static\n"
        # Do one analysis for constant axial load
        analyze = "analyze {}\n".format(10) 
        lC = "loadConst -time 0.0\n"
        # Define reference moment 
        recorderName1 = self.recorderName + "Force" + ".out"
        recorderName2 = self.recorderName + "Disp" + ".out"
        recorder1 = "recorder Element -file {} -ele 1 section force\n".format(recorderName1)
        #recorder2 = "recorder Element -file {} -ele 1 section deformation\n".format(recorderName2)
        patternM = 'pattern Plain {} "{}" {}\n'.format( 2, 'Linear', "{;")   
        # Use displacement control at node 2 for section analysis
        loadM = "load {} {} {} {} {} {} {};\n".format(2, 0.0, 0.0, 0.0, 0.0, 1.0, 0.0) +  "}\n" 
        IntegratorD = "integrator DisplacementControl {} {} {}\n".format(2, 5, self.maxPhi/self.numIncr)
        #IntegratorD = 'integrator ' + self.Integrator.ToString() + "\n"
        analyze2 = "analyze {}\n".format(self.numIncr) + "\n" + "wipe"+ "\n"

        return clean + model + material + section +  node1 + node2 + fix1 + fix2 + ele + pattern + load + Integrator + System + Test + number + constraints + algorithm + analysis + analyze +lC + recorder1 + patternM + loadM + IntegratorD + analyze2


def RunMCpositive(Pi): 
    if Pi > 0.0:
        recorderFileName = "MKsectionP{}positiveMpositive".format(int(mt.fabs(Pi)))
        outputFileName = "OSSModel{}positiveMpositive".format(int(mt.fabs(Pi)))
    elif Pi < 0.0:
        recorderFileName = "MKsectionP{}negativeMpositive".format(int(mt.fabs(Pi)))
        outputFileName = "OSSModel{}negativeMpositive".format(int(mt.fabs(Pi)))
        
    alpha = linspace(0,360, 36)
    
    
    listN = []
    listM1 = []
    listM2 = []
    for alphai in alpha:
        MC = MomentCurvature(recorderFileName,FiberSection, float(Pi), alphai, 2.0, 1000) #mu*FiberSection.Ky
        script = MC.write_tcl()
    
        FolderPath = rs.DocumentPath()
        os.chdir(FolderPath)
        
        recorderFileName1 = recorderFileName + "Force" + ".out"
        recorderFileName2 = recorderFileName + "Disp" + ".out"
    
        runFileName = os.path.join(FolderPath,outputFileName)
        filepath1 = os.path.join(FolderPath,recorderFileName1)
        #filepath2 = os.path.join(FolderPath,recorderFileName2)
        time_start = time.clock()
    
        with open(outputFileName, 'w') as f:
            for line in MC.write_tcl():
                f.write(line)
            f.close()
    
        time_elapsed = (time.clock() - time_start)
        #print("Writing Time {}".format(time_elapsed))
        
        time_start = time.clock()
        
        executable = os.path.join(ghcompfolder,'Alpaca4d\OpenSees-Solvers\opensees.bat')
        #executable = os.path.join(ghcompfolder,'C:\OpenSees\bin\opensees.bat')
        
        #process = subprocess.Popen([r'C:\OpenSees\bin\OpenSees', outputFileName], shell = True, stdout=subprocess.PIPE, stderr=subprocess.PIPE)
        process = subprocess.Popen([executable, outputFileName], shell = True,  stdout=subprocess.PIPE, stderr=subprocess.PIPE)
        stdout, stderr = process.communicate()
        #print(stdout, stderr)
        process.kill()
        os.remove(runFileName)
        time_elapsed = (time.clock() - time_start)
        #print("Analyses Time {}".format(time_elapsed))
        #filepath = os.path.join(r'C:\OpenSees\bin',recorderFileName)
        fileObj = open(filepath1, 'r')
        words = fileObj.read().splitlines(" ")
        #print(fileObj.read())
        N = "None"
        if len(words) != 0:
            N = float(words[-1].split()[0])
            M1 = float(words[-1].split()[1])
            M2 = float(words[-1].split()[2])
            
            listN.append(N)
            listM1.append(M1)
            listM2.append(M2)
        fileObj.close()

        os.remove(filepath1)
    """
    fileObj = open(filepath2, 'r')
    words = fileObj.read().splitlines(" ")
    #print(fileObj.read())

    k1 = [ float(i.split()[1]) for i in words]
    k2 = [ float(i.split()[2]) for i in words]
    k3 = [ float(i.split()[3]) for i in words]
    fileObj.close()
    """
        #os.remove(filepath2)
    if N != "None" :
        return [listN, listM1, listM2]


        
        

        
if checkData:
    FiberSection.secTag = 1
    for i, item in enumerate(FiberSection.path):
        item.material.matTag = 2*(i+1)
        item.material.matTagMinMax = 2*i+1
        #print(item.material.matTag )
    j = i+2
    for i, item in enumerate(FiberSection.layer):
        j = j + i 
        item.material.matTag = 2*(j+1)
        item.material.matTagMinMax = 2*j+1
        #print(j+i)
    w = j+2
    for i, item in enumerate(FiberSection.fiber):
        w = w + i 
        item.material.matTag = 2*(w+1)
        item.material.matTagMinMax = 2*w+1
        
#A = ghp.run(RunNEps,[-1.0, 1.0], True)



    
print(FiberSection.NultNeg+0.1*FiberSection.NultNeg,FiberSection.NultPos)


#n1 = int(mt.fabs(min(A)/stepValorPositive))
#n2 = int(mt.fabs(max(A)/stepValorNegative))

#listP = linspace(min(A), -5.0, n1) + linspace(5, max(A)-10.0, n2)


    
listP = linspace(FiberSection.NultNeg,FiberSection.NultPos, nPoint)


B = ghp.run(RunMCpositive, listP,False)
B =filter(None, B)
#C = ghp.run(RunMCnegative, listP,False)

#print(B[1])
#RunM1Cpositive(Pi): 

N, M1, M2 = [], [], []

for item in B:
    #item =filter(None, item) #elimino il None
    N.append(item[0])
    M1.append(item[1])
    M2.append(item[2])


N, M1, M2 = th.list_to_tree(N), th.list_to_tree(M1), th.list_to_tree(M2)



"""
for item in B:
    Nupos.append(item[0])
    M1uP.append( item[1])
    M2uP.append( item[2])
    #M3uP.append( item[3])
    
for item in C:
    Nuneg.append(item[0])
    M1uN.append( item[1])
    M2uN.append( item[2])

M1 = M1uN + M1uP[::-1] + M1uN[0:1]
M2 = M2uN + M2uP[::-1] + M2uN[0:1]
N = Nuneg + Nupos[::-1] + Nuneg[0:1]

if direction == 1:
    M = M2
else:
    M = M1
"""
# ---------- end _3dd ----------
panel_3 = Panel("""4
4
4
4
4
4
2
4
4
2
4
4""")
crv_9 = Curve([item_3.Item1, item_3.Item3, item_3.Item5, item_3.Item7])
number_slider_24 = Slider(20, range=0..100)
panel_4 = Panel(_3dd.N)
multiplication_7 = Multiplication(A=_3dd.N, B=Slider(0.1, range=0..0.1))
pt_3 = ConstructPoint(XCoordinate=_3dd.M1, YCoordinate=_3dd.M2, ZCoordinate=multiplication_7)
multiplication_8 = Multiplication(A=pt_3)
image = ImageSampler(
    FilePath="C:\Users\Domen\Desktop\Alpaca MC\diagram N-M.png",
    Filter="Colour",
    Interpolate=False,
    Umax=300,
    Umin=1,
    Vmax=300,
    Vmin=1,
    Wrap=0)
number_slider_25 = Slider(1582, range=0..10000)
intcrv = Interpolate(Vertices=multiplication_8, Degree=3, Periodic=Toggle(True), KnotStyle=1)  # -> flatten(Curve), Length, Domain
image_2 = ImageSampler(
    FilePath="C:\Users\Domen\Desktop\Alpaca MC\diagram N-M.png",
    Filter="Colour",
    Interpolate=True,
    Umax=640,
    Umin=1,
    Vmax=480,
    Vmin=1,
    Wrap=0)
loft = Loft(
    Curves=flatten(intcrv.Curve),
    Options={Adjust=False, Closed=False, LoftEnds=0, LoftSimp=0, LoftType=0, Rebuild=10, Refit=0.01})
item_8 = ListItem(List=cluster_2, Index=0, Wrap=True)
debrep_2 = DeconstructBrep(Brep=loft)  # -> Faces, Edges, Vertices
mesh_uv = MeshSurface(Surface=debrep_2.Faces, UCount=Slider(53, range=0..100), VCount=Slider(2, range=0..100), Overhang=True, Equalize=False)
clean = CombineClean(Meshes=flatten(mesh_uv))
facen = FaceNormals(Mesh=clean)  # -> Centers, Normals
material = CreateMaterial(
    Diffuse=ColourSwatch(SwatchColor=RGB(0, 0, 0)),
    Specular=RGB(255, 255, 255),
    Emission=RGB(0, 0, 0),
    Transparency=Slider(0.8, range=0..1),
    Shine=0)
demesh = DeconstructMesh(Mesh=clean)  # -> Vertices, Faces, Colours, Normals
deface = DeconstructFace(Face=demesh.Faces)  # -> CornerA, CornerB, CornerC, CornerD
pdecon = Deconstruct(Point=facen.Centers)  # -> XComponent, YComponent, ZComponent
clr = ColorsAlpaca4d(gradIndex=Slider(3, range=0..10))  # -> colors; inputs gradIndex: Int32
#   port colors: A series of colors to be plugged into the "Ladybug_Legend Parameters" component.
# ---------- clr: Python ----------
"""
Preset of gradient colors perfect for Data Visualisation
    Inputs:
        gradIndex: An index refering to one of the following possible gradients:
            0 - Orignal Ladybug
            1 - Nuanced Ladybug
            2 - Multi-colored Ladybug
            3 - Ecotect
            4 - Thermal Comfort Percentage
            5 - Thermal Comfort Colors
            6 - Shade Benefit/Harm
            7 - Shade Harm
            8 - Shade Benefit
            9 - CFD Colors 1
            10 - Radiation Benefit
            11 - Gsa10 Colour
            12 - Gsa9 Colour
    Returns:
        customColors: A series of colors.
"""

ghenv.Component.Name = "Colors (Alpaca4d)"
ghenv.Component.NickName = 'CLR'
ghenv.Component.Message = 'Colors (Alpaca4d)'

import scriptcontext as sc
import Grasshopper.Kernel as gh
import System

gradientLibrary = {
        0: [System.Drawing.Color.FromArgb(75, 107, 169), System.Drawing.Color.FromArgb(115, 147, 202), System.Drawing.Color.FromArgb(170, 200, 247), System.Drawing.Color.FromArgb(193, 213, 208), System.Drawing.Color.FromArgb(245, 239, 103), System.Drawing.Color.FromArgb(252, 230, 74), System.Drawing.Color.FromArgb(239, 156, 21), System.Drawing.Color.FromArgb(234, 123, 0), System.Drawing.Color.FromArgb(234, 74, 0), System.Drawing.Color.FromArgb(234, 38, 0)],
        1: [System.Drawing.Color.FromArgb(49,54,149), System.Drawing.Color.FromArgb(69,117,180), System.Drawing.Color.FromArgb(116,173,209), System.Drawing.Color.FromArgb(171,217,233), System.Drawing.Color.FromArgb(224,243,248), System.Drawing.Color.FromArgb(255,255,191), System.Drawing.Color.FromArgb(254,224,144), System.Drawing.Color.FromArgb(253,174,97), System.Drawing.Color.FromArgb(244,109,67), System.Drawing.Color.FromArgb(215,48,39), System.Drawing.Color.FromArgb(165,0,38)],
        2: [System.Drawing.Color.FromArgb(4,25,145), System.Drawing.Color.FromArgb(7,48,224), System.Drawing.Color.FromArgb(7,88,255), System.Drawing.Color.FromArgb(1,232,255), System.Drawing.Color.FromArgb(97,246,156), System.Drawing.Color.FromArgb(166,249,86), System.Drawing.Color.FromArgb(254,244,1), System.Drawing.Color.FromArgb(255,121,0), System.Drawing.Color.FromArgb(239,39,0), System.Drawing.Color.FromArgb(138,17,0)],
        3: [System.Drawing.Color.FromArgb(0,0,255), System.Drawing.Color.FromArgb(53,0,202), System.Drawing.Color.FromArgb(107,0,148), System.Drawing.Color.FromArgb(160,0,95), System.Drawing.Color.FromArgb(214,0,41), System.Drawing.Color.FromArgb(255,12,0), System.Drawing.Color.FromArgb(255,66,0), System.Drawing.Color.FromArgb(255,119,0), System.Drawing.Color.FromArgb(255,173,0), System.Drawing.Color.FromArgb(255,226,0), System.Drawing.Color.FromArgb(255,255,0)],
        4: [System.Drawing.Color.FromArgb(0,0,0), System.Drawing.Color.FromArgb(110,0,153), System.Drawing.Color.FromArgb(255,0,0), System.Drawing.Color.FromArgb(255,255,102), System.Drawing.Color.FromArgb(255,255,255)],
        5: [System.Drawing.Color.FromArgb(0,136,255), System.Drawing.Color.FromArgb(200,225,255), System.Drawing.Color.FromArgb(255,255,255), System.Drawing.Color.FromArgb(255,230,230), System.Drawing.Color.FromArgb(255,0,0)],
        6: [System.Drawing.Color.FromArgb(5,48,97), System.Drawing.Color.FromArgb(33,102,172), System.Drawing.Color.FromArgb(67,147,195), System.Drawing.Color.FromArgb(146,197,222), System.Drawing.Color.FromArgb(209,229,240), System.Drawing.Color.FromArgb(255,255,255), System.Drawing.Color.FromArgb(253,219,199), System.Drawing.Color.FromArgb(244,165,130), System.Drawing.Color.FromArgb(214,96,77), System.Drawing.Color.FromArgb(178,24,43), System.Drawing.Color.FromArgb(103,0,31)],
        7: [System.Drawing.Color.FromArgb(255,255,255), System.Drawing.Color.FromArgb(253,219,199), System.Drawing.Color.FromArgb(244,165,130), System.Drawing.Color.FromArgb(214,96,77), System.Drawing.Color.FromArgb(178,24,43), System.Drawing.Color.FromArgb(103,0,31)],
        8: [System.Drawing.Color.FromArgb(255,255,255), System.Drawing.Color.FromArgb(209,229,240), System.Drawing.Color.FromArgb(146,197,222), System.Drawing.Color.FromArgb(67,147,195), System.Drawing.Color.FromArgb(33,102,172), System.Drawing.Color.FromArgb(5,48,97)],
        9: [System.Drawing.Color.FromArgb(0,16,120), System.Drawing.Color.FromArgb(38,70,160), System.Drawing.Color.FromArgb(5,180,222), System.Drawing.Color.FromArgb(16,180,109), System.Drawing.Color.FromArgb(59,183,35), System.Drawing.Color.FromArgb(143,209,19), System.Drawing.Color.FromArgb(228,215,29), System.Drawing.Color.FromArgb(246,147,17), System.Drawing.Color.FromArgb(243,74,0), System.Drawing.Color.FromArgb(255,0,0)],
        10: [System.Drawing.Color.FromArgb(0,191,48), System.Drawing.Color.FromArgb(255,238,184), System.Drawing.Color.FromArgb(255,0,0)],
        11: [System.Drawing.Color.FromArgb(204,0,71), System.Drawing.Color.FromArgb(255,182,71), System.Drawing.Color.FromArgb(206,255,115), System.Drawing.Color.FromArgb(26,180, 214),System.Drawing.Color.FromArgb(0,0,207)],
        12: [System.Drawing.Color.FromArgb(255, 51, 51), System.Drawing.Color.FromArgb(255, 170, 51), System.Drawing.Color.FromArgb(255, 255, 51), System.Drawing.Color.FromArgb(170, 255, 125), System.Drawing.Color.FromArgb(51, 255, 231), System.Drawing.Color.FromArgb(51, 170, 255), System.Drawing.Color.FromArgb(51,51, 255)]}
colors = gradientLibrary[gradIndex]
# ---------- end clr ----------
bnd = Bounds(Numbers=pdecon.ZComponent)
preview = CustomPreview(Geometry=clean, Material=material)
dedomain = DeconstructDomain(Domain=bnd)  # -> Start, End
abs = Absolute(Value=[dedomain.End, dedomain.Start])
number_slider_26 = Slider(2, range=0..10)
bnd_2 = Bounds(Numbers=abs)
gradient = Gradient(
    LowerLimit=dedomain.Start,
    UpperLimit=dedomain.End,
    Parameter=demesh.Vertices,
    stops=[0: RGB(243, 57, 0), 0.1: RGB(236, 27, 60), 0.2: RGB(210, 0, 118), 0.3: RGB(103, 0, 120), 0.4: RGB(39, 72, 161), 0.5: RGB(1, 192, 229), 0.6: RGB(18, 178, 90), 0.7: RGB(79, 186, 8), 0.8: RGB(220, 237, 32), 0.9: RGB(247, 159, 20), 1: RGB(243, 57, 0)])
number_slider_27 = Slider(1000, range=0..10000)
number_slider_28 = Slider(180, range=0..180)
panel_5 = Panel("""-2000
-1000""")
dedomain_2 = DeconstructDomain(Domain=bnd_2)  # -> Start, End
division_3 = Division(A=pdecon.ZComponent, B=dedomain_2.End)
interp = InterpolateData(Data=clr, Parameter=division_3, Interpolation=2)
neg_7 = Negative(Value=Slider(2000, range=0..10000))

panel_6 = Panel("Axial load |KN|")  # disabled
panel_7 = Panel("Bending Moment |KNm|")  # disabled
panel_8 = Panel("Domain 3D N-M")  # disabled
panel_9 = Panel("Domain 3D N-M")  # disabled
gh_cpython = GH_CPython(
    data_X=flatten(_3dd.M1),
    data_Y=flatten(_3dd.M2),
    data_Z=flatten(_3dd.N),
    name_AxisX=panel_6,
    name_AxisY=panel_7,
    title=panel_8,
    NameSave=panel_9)  # -> output, pathSave; inputs data_X: list, data_Y: list, data_Z: list, name_AxisX: list, name_AxisY: list, title: list, NameSave: list; disabled
# ---------- gh_cpython: Python ----------
# -*- coding: utf-8 -*-
""" 
Python Script
Created on  Saturday August 2021 05:11:41 
@author:  Domen 

[desc]
Description of the plugin Here
Write here any thing... 
[/desc]

ARGUMENTS:
----------
<inp> 
    _input :[required] - [type = int] - [default = None] 
    Descripe your input here 
        * bullet point.
        * bullet point
</inp>
<inp>
    Other inputs go here ...
</inp>

RETURN:
----------
    <out>
        output_ : indicate your output description here. \n refers to a new line.
    </out>

"""
import matplotlib.pyplot as plt
import numpy as np
import os
from mpl_toolkits import mplot3d


print('getcwd:      ', os.getcwd())
print('__file__:    ', __file__)

pathSave = os.path.join(os.getcwd(), "NameSave"+ ".png")
 
# Data for plotting
x = data_X
y = data_Y
z = data_Z

X, Y = np.meshgrid(x, y)

#X=[i for n in x for i in n]
#Y=[i for n in y for i in n]


fig = plt.figure()
# syntax for 3-D plotting
ax = plt.axes(projection ='3d')

# syntax for plotting
#ax.scatter(X, Y, Z, c = z, cmap ='viridis')
ax.scatter(x, y, z, c = z, cmap ='viridis')
#ax.plot_surface(X, Y, z, cmap ='viridis', edgecolor ='green')
#ax.set_title('Surface plot geeks for geeks')
fig.savefig(title +".png")
#plt.show()
#plt.savefig(pathSave)
# ---------- end gh_cpython ----------

number_slider_29 = Slider(100, range=0..100)  # disabled
mcol = MeshColours(Mesh=clean, Colours=interp)
number_slider_30 = Slider(100, range=0..100)  # disabled
pi = Pi(Factor=Slider(2, range=0..2))
image_3 = ImageSampler(
    FilePath="C:\Users\Domen\Desktop\Alpaca MC\Domain 3D N-M.png",
    Filter="Colour",
    Interpolate=True,
    Umax=300,
    Umin=1,
    Vmax=300,
    Vmin=1,
    Wrap=0)  # disabled
rotate_2 = Rotate(Geometry=mcol, Angle=pi, Plane=PlaneXY(0, 0, 0))  # -> Geometry, Transform
image_4 = ImageSampler(
    FilePath="C:\Users\Domen\Desktop\Alpaca MC\diagram M-k.png",
    Filter="Colour",
    Interpolate=True,
    Umax=640,
    Umin=1,
    Vmax=480,
    Vmin=1,
    Wrap=0)  # disabled
panel_10 = Panel("M-k")  # disabled
panel_11 = Panel("M-k")  # disabled
intcrv_2 = Interpolate(Degree=3, Periodic=False, KnotStyle=1)  # -> Curve, Length, Domain
gh_cpython_2 = GH_CPython(name_AxisX="Curvature", name_AxisY="Bending Moment |KNm|", title=panel_10, NameSave=panel_11)  # -> output, pathSave; inputs data_X: list, data_Y: list, name_AxisX: list, name_AxisY: list, legend: list, title: list, NameSave: list; disabled
# ---------- gh_cpython_2: Python ----------
# -*- coding: utf-8 -*-
""" 
Python Script
Created on  Saturday August 2021 05:11:41 
@author:  Domen 

[desc]
Description of the plugin Here
Write here any thing... 
[/desc]

ARGUMENTS:
----------
<inp> 
    _input :[required] - [type = int] - [default = None] 
    Descripe your input here 
        * bullet point.
        * bullet point
</inp>
<inp>
    Other inputs go here ...
</inp>

RETURN:
----------
    <out>
        output_ : indicate your output description here. \n refers to a new line.
    </out>

"""
import matplotlib.pyplot as plt
import numpy as np
import os

print('getcwd:      ', os.getcwd())
print('__file__:    ', __file__)

pathSave = os.path.join(os.getcwd(), "NameSave"+ ".png")
 
# Data for plotting
t = data_X
s = data_Y



fig, ax = plt.subplots()
for itemX, itemY, Ilegend in zip(t, s, legend):
    ax.plot(itemX, itemY, label ='axis load = ' + str(Ilegend))

ax.set(xlabel=name_AxisX, ylabel=name_AxisY,
       title=title)

ax.legend(loc ="lower right")
ax.grid()

fig.savefig(title +".png")
#plt.savefig(pathSave)
# ---------- end gh_cpython_2 ----------
image_5 = ImageSampler(
    FilePath="C:\Users\Domen\Desktop\Alpaca MC\M-k.png",
    Filter="Colour",
    Interpolate=True,
    Umax=640,
    Umin=1,
    Vmax=480,
    Vmin=1,
    Wrap=0)  # disabled
number_slider_31 = Slider(0, range=0..100)
number_slider_32 = Slider(0, range=0..1)

# ---- group: MATERIAL
panel_12 = Panel("210000")
panel_13 = Panel("255")
panel_14 = Panel("-14.17")
panel_16 = Panel("-12.47")
panel_17 = Panel("-10.46")
panel_18 = Panel("200000.0")
panel_19 = Panel("391.3")
panel_20 = Panel("0.0")
panel_21 = Panel("0.0")
uemc01 = UniaxialElasticMaterialConcreate01Alpaca4d(MinMaxLimit=toggle, fc=multiplication_2, fcu=multiplication_3, ec0="-0.002", ecu="-0.0035")  # -> out, uniAxialMaterial; inputs MinMaxLimit: Boolean
# ---------- uemc01: Python ----------
"""
Create a uniaxial Elastic Material Concreate01
-
    Args:
        fc:
        fcu:
        ec0:
        ecu:
    Returns:
        uniAxialMaterial:
"""

__author__ = "Ing. Domenico Gaudioso"
__contact__ = "DomenicoGaudioso@outlook.it"
__version__ = "2021.09.17"

ghenv.Component.Name = "uniaxial Elastic Material Concreate01 (Alpaca4d)"
ghenv.Component.NickName = 'UEMC01'
ghenv.Component.Message = "uniaxial Concreate01 (Alpaca4d)"

import sys
import Rhino.Geometry as rg
import Grasshopper as gh
import copy


## add alpaca install directory to system path

ghcompfolder = gh.Folders.DefaultAssemblyFolder
if ghcompfolder not in sys.path:
    sys.path.append(ghcompfolder)

try:
    from Alpaca4d import alpaca4d as alpaca
except:
    msg = "Cannot import Alpaca4d. Is the Alpaca4d folder available in " + ghcompfolder + "?"
    ghenv.Component.AddRuntimeMessage(gh.Kernel.GH_RuntimeMessageLevel.Error, msg)


checkData = True

if not fc:
    checkData = False
    msg = "Input parameter fc failed to collect data"
    ghenv.Component.AddRuntimeMessage(gh.Kernel.GH_RuntimeMessageLevel.Warning, msg)

if fcu == 'None':
    checkData = False
    msg = "Input parameter fcu failed to collect data"
    ghenv.Component.AddRuntimeMessage(gh.Kernel.GH_RuntimeMessageLevel.Warning, msg)

if not ec0:
    checkData = False
    msg = "Input parameter ec0 failed to collect data"
    ghenv.Component.AddRuntimeMessage(gh.Kernel.GH_RuntimeMessageLevel.Warning, msg)

if not ecu:
    checkData = False
    msg = "Input parameter ecu failed to collect data"
    ghenv.Component.AddRuntimeMessage(gh.Kernel.GH_RuntimeMessageLevel.Warning, msg)


class uniAxialMaterialConcreate01(object):
    def __init__(self, matName, MinMaxLimit, fc, ec0, fcu, ecu):
        '''Generate a uniaxial Elastic Material Concreate01
            link for information: https://opensees.berkeley.edu/wiki/index.php/Concrete01_Material_--_Zero_Tensile_Strength
            Inputs:
                matName: Name of the material.
                fc:  concrete compressive strength at 28 days (compression is negative) [MPa].
                fcu: concrete crushing strength[MPa].
                ec0: concrete strain at maximum strength.
                ecu: concrete strain at crushing strength.'''


        self.matName = matName
        self.MinMaxLimit = MinMaxLimit
        self.fc = fc
        self.fcu = fcu
        self.ec0 = ec0
        self.ecu = ecu
        self.tensionLimitPositive = 0.0
        self.tensionLimitNegative = self.fcu
        self.matTag = None
        self.matTagMinMax = None
        
        self.materialDimension = "uniAxialMaterial"
        self.materialType = "Concrete01"

    def ToString(self):
        return self.write_tcl()

    def write_tcl(self):
        a = "uniaxialMaterial Concrete01 {} {} {} {} {}\n".format(self.matTag, self.fc, self.ec0, self.fcu, self.ecu)
        b = "uniaxialMaterial MinMax {} {} -min {} -max {}\n".format(self.matTagMinMax, self.matTag, self.ecu, 0.0)
        if MinMaxLimit == True :
            return a + b
        else :
            return a
            
        
    def write_py(self):
        return "ops.uniaxialMaterial('Concrete01', {}, {}, {}, {}, {})\n".format(self.matTag, self.fc, self.ec0, self.fcu, self.ecu)


if checkData:
    uniAxialMaterial = uniAxialMaterialConcreate01(name, MinMaxLimit, fc, ec0, fcu, ecu)
# ---------- end uemc01 ----------

# ----
multiplication_9 = Multiplication(A=panel_13, B=1000)
multiplication_10 = Multiplication(A=panel_12, B=1000)
multiplication_11 = Multiplication(A=panel_17, B=1000)
multiplication_12 = Multiplication(A=panel_16, B=1000)
multiplication_13 = Multiplication(A=panel_19, B=1000)
multiplication_14 = Multiplication(A=panel_18, B=1000)
multiplication_15 = Multiplication(A=panel_20, B=1000)

# ---- group: MATERIAL (continued)
uemc02 = UniaxialElasticMaterialConcreate02Alpaca4d(
    MinMaxLimit=toggle,
    fpc=multiplication_12,
    fpcu=multiplication_11,
    epc0="-0.002",
    epcu="-0.0035",
    lambd="0.1",
    ft=multiplication_6,
    Ets=multiplication_4)  # -> out, uniAxialMaterial; inputs MinMaxLimit: Boolean
# ---------- uemc02: Python ----------
"""
Create a uniaxial Elastic Material Concreate01
-
    Args:
        fpc: concrete compressive strength at 28 days (compression is negative)*
        fpcu: concrete crushing strength *
        epc0: concrete strain at maximum strength*
        epcu: concrete strain at crushing strength*
        lambd: ratio between unloading slope at $epscu and initial slope
        ft:	tensile strength
        Ets: tension softening stiffness (absolute value) (slope of the linear tension softening branch)

    Returns:
        uniAxialMaterial:
"""

__author__ = "Ing. Domenico Gaudioso"
__contact__ = "DomenicoGaudioso@outlook.it"
__version__ = "2021.09.17"


ghenv.Component.Name = "uniaxial Elastic Material Concreate02 (Alpaca4d)"
ghenv.Component.NickName = 'UEMC02'
ghenv.Component.Message = "uniaxial Concreate02 (Alpaca4d)"

import sys
import Rhino.Geometry as rg
import Grasshopper as gh
import copy


## add alpaca install directory to system path

ghcompfolder = gh.Folders.DefaultAssemblyFolder
if ghcompfolder not in sys.path:
    sys.path.append(ghcompfolder)

try:
    from Alpaca4d import alpaca4d as alpaca
except:
    msg = "Cannot import Alpaca4d. Is the Alpaca4d folder available in " + ghcompfolder + "?"
    ghenv.Component.AddRuntimeMessage(gh.Kernel.GH_RuntimeMessageLevel.Error, msg)


checkData = True

if not fpc:
    checkData = False
    msg = "Input parameter fpc failed to collect data"
    ghenv.Component.AddRuntimeMessage(gh.Kernel.GH_RuntimeMessageLevel.Warning, msg)

if fpcu == 'None':
    checkData = False
    msg = "Input parameter fpcu failed to collect data"
    ghenv.Component.AddRuntimeMessage(gh.Kernel.GH_RuntimeMessageLevel.Warning, msg)

if not epc0:
    checkData = False
    msg = "Input parameter epc0 failed to collect data"
    ghenv.Component.AddRuntimeMessage(gh.Kernel.GH_RuntimeMessageLevel.Warning, msg)

if not epcu:
    checkData = False
    msg = "Input parameter epcu failed to collect data"
    ghenv.Component.AddRuntimeMessage(gh.Kernel.GH_RuntimeMessageLevel.Warning, msg)

if not lambd:
    checkData = False
    msg = "Input parameter lambd failed to collect data"
    ghenv.Component.AddRuntimeMessage(gh.Kernel.GH_RuntimeMessageLevel.Warning, msg)

if not ft:
    checkData = False
    msg = "Input parameter ft failed to collect data"
    ghenv.Component.AddRuntimeMessage(gh.Kernel.GH_RuntimeMessageLevel.Warning, msg)

if not Ets:
    checkData = False
    msg = "Input parameter Ets failed to collect data"
    ghenv.Component.AddRuntimeMessage(gh.Kernel.GH_RuntimeMessageLevel.Warning, msg)
    

class uniAxialMaterialConcreate02(object):
    def __init__(self, matName, MinMaxLimit, fpc, epc0, fpcu, epcu, lambd, ft, Ets):
        """Generate a uniaxial Elastic Material Concreate02
            link for information: https://opensees.berkeley.edu/wiki/index.php/Concrete02_Material_--_Linear_Tension_Softening
            Inputs:
                fpc: concrete compressive strength at 28 days (compression is negative)*
                fpcu: concrete crushing strength *
                epc0: concrete strain at maximum strength*
                epcu: concrete strain at crushing strength*
                lambd: ratio between unloading slope at $epscu and initial slope
                ft:	tensile strength
                Ets: tension softening stiffness (absolute value) (slope of the linear tension softening branch)
         """


        self.matName = matName
        self.MinMaxLimit = MinMaxLimit
        self.fpc = fpc
        self.fpcu = fpcu
        self.epc0 = epc0
        self.epcu = epcu
        self.lambd = lambd
        self.ft = ft
        self.Ets = Ets
        self.tensionLimitPositive = self.ft
        self.tensionLimitNegative = self.fpcu
        self.matTag = None
        self.matTagMinMax = None
        
        self.materialDimension = "uniAxialMaterial"
        self.materialType = "Concrete02"

    def ToString(self):
        return self.write_tcl()

    def write_tcl(self):
        a = "uniaxialMaterial Concrete02 {} {} {} {} {} {} {} {}\n".format(self.matTag, self.fpc, self.epc0, self.fpcu, self.epcu, self.lambd, self.ft, self.Ets)
        b = "uniaxialMaterial MinMax {} {} -min {} -max {}\n".format(self.matTagMinMax, self.matTag, self.epcu, self.ft/self.Ets)
        if MinMaxLimit == True:
            return a + b
        else :
            return a
        
    def write_py(self):
        return "ops.uniaxialMaterial('Concrete02', {}, {}, {}, {}, {})\n".format(self.matTag, self.fc, self.ec0, self.fcu, self.ecu)


if checkData:
    uniAxialMaterial = uniAxialMaterialConcreate02(name, MinMaxLimit, fpc, epc0, fpcu, epcu, lambd, ft, Ets)
# ---------- end uemc02 ----------
uems01 = UniaxialElasticMaterialSteel01Alpaca4d(MinMaxLimit=toggle, fy=multiplication_9, E0=multiplication_10, b=panel_21)  # -> out, uniAxialMaterial; inputs MinMaxLimit: Boolean
# ---------- uems01: Python ----------
"""
Create a uniaxial Elastic Material Concreate01
-
    Args:
        fc:
        fcu:
        ec0:
        ecu:
    Returns:
        uniAxialMaterial:
"""

__author__ = "Ing. Domenico Gaudioso"
__contact__ = "DomenicoGaudioso@outlook.it"
__version__ = "2021.09.17"

ghenv.Component.Name = "uniaxial Elastic Material Steel01 (Alpaca4d)"
ghenv.Component.NickName = 'UEMS01'
ghenv.Component.Message = "uniaxial Steel01 (Alpaca4d)"

import sys
import Rhino.Geometry as rg
import Grasshopper as gh
import copy


## add alpaca install directory to system path

ghcompfolder = gh.Folders.DefaultAssemblyFolder
if ghcompfolder not in sys.path:
    sys.path.append(ghcompfolder)


   
   
try:
    from Alpaca4d import alpaca4d as alpaca
except:
    msg = "Cannot import Alpaca4d. Is the Alpaca4d folder available in " + ghcompfolder + "?"
    ghenv.Component.AddRuntimeMessage(gh.Kernel.GH_RuntimeMessageLevel.Error, msg)

print(a1!=None, a2, a3, a4)

checkData = True

if not fy:
    checkData = False
    msg = "Input parameter fy failed to collect data"
    ghenv.Component.AddRuntimeMessage(gh.Kernel.GH_RuntimeMessageLevel.Warning, msg)

if not E0:
    checkData = False
    msg = "Input parameter E0 failed to collect data"
    ghenv.Component.AddRuntimeMessage(gh.Kernel.GH_RuntimeMessageLevel.Warning, msg)
"""
if not b:
    checkData = False
    msg = "Input parameter b failed to collect data"
    ghenv.Component.AddRuntimeMessage(gh.Kernel.GH_RuntimeMessageLevel.Warning, msg)
"""

class uniAxialMaterialSteel01(object):
    def __init__(self, matName, MinMaxLimit, fy, E0, b, a1, a2, a3, a4):
        '''Generate a uniaxial Elastic Material Steel01
            link for information: https://opensees.berkeley.edu/wiki/index.php/Steel01_Material
            Inputs:
                matName: Name of the material.
                fy: yield strength [MPa].
                E0: initial elastic tangent[MPa].
                b: strain-hardening ratio (ratio between post-yield tangent and initial elastic tangent).
                a1: isotropic hardening parameter, increase of compression yield envelope as proportion of yield strength after a plastic strain of $a2*($Fy/E0). (optional).
                a2: isotropic hardening parameter (see explanation under $a1). (optional).
                a3: isotropic hardening parameter, increase of tension yield envelope as proportion of yield strength after a plastic strain of $a4*($Fy/E0). (optional)
                a4: isotropic hardening parameter (see explanation under $a3). (optional)'''

        self.matName = matName
        self.MinMaxLimit = MinMaxLimit
        self.fy = fy
        self.E0 = E0
        self.b = b
        self.a1 = a1
        self.a2 = a2
        self.a3 = a3
        self.a4 = a4
        
        self.tensionLimitPositive = self.fy
        self.tensionLimitNegative = -self.fy
        
        self.matTag = None
        self.matTagMinMax = None
        
        self.materialDimension = "uniAxialMaterial"
        self.materialType = "Steel01"
        
        self.esh = self.fy/self.E0
        self.eult = 6.75/100

    def ToString(self):
        return self.write_tcl()

    def write_tcl(self):
        if a1 != None and a2 == None and a3 == None and a4 == None:
            return "uniaxialMaterial Steel01 {} {} {} {} {}\n".format(self.matTag, self.fy, self.E0, self.b, self.a1)
        elif a1 != None and a2 != None and a3 == None and a4 == None:
            return "uniaxialMaterial Steel01 {} {} {} {} {} {}\n".format(self.matTag, self.fy, self.E0, self.b, self.a1, self.a2) 
        elif a1 != None and a2 != None and a3 != None and a4 == None:
            return "uniaxialMaterial Steel01 {} {} {} {} {} {} {}\n".format(self.matTag, self.fy, self.E0, self.b, self.a1, self.a2, self.a3) 
        elif a1 == None and a2 == None and a3 == None and a4 == None and self.MinMaxLimit== None:
            return "uniaxialMaterial Steel01 {} {} {} {}\n".format(self.matTag, self.fy, self.E0, self.b) 
        elif self.a1 == None and self.a2 == None and self.a3 == None and self.a4 == None and self.MinMaxLimit== True:            
            a = "uniaxialMaterial Steel01 {} {} {} {}\n".format(self.matTag, self.fy, self.E0, self.b)
            b = "uniaxialMaterial MinMax {} {} -min {} -max {}\n".format(self.matTagMinMax, self.matTag, -self.eult, self.eult)
            return a + b
    def write_py(self):
        if a1 != None and a2 == None and a3 == None and a4 == None:
            return "ops.uniaxialMaterial('Steel01', {}, {}, {}, {}, {})\n".format(self.matTag, self.fy, self.E0, self.b, self.a1)
        elif a1 != None and a2 != None and a3 == None and a4 == None:
            return "ops.uniaxialMaterial('Steel01', {}, {}, {}, {}, {}, {})\n".format(self.matTag, self.fy, self.E0, self.b, self.a1, self.a2) 
        elif a1 != None and a2 != None and a3 != None and a4 == None:
            return "ops.uniaxialMaterial('Steel01', {}, {}, {}, {}, {}, {}, {})\n".format(self.matTag, self.fy, self.E0, self.b, self.a1, self.a2, self.a3) 
        elif a1 != None and a2 != None and a3 != None and a4 != None:
            return "ops.uniaxialMaterial('Steel01', {}, {}, {}, {}, {}, {}, {}, {})\n".format(self.matTag, self.fy, self.E0, self.b, self.a1, self.a2, self.a3,  self.a4) 
        else:
            return "ops.uniaxialMaterial('Steel01', {}, {}, {}, {})\n".format(self.matTag, self.fy, self.E0, self.b)


if checkData:
    uniAxialMaterial = uniAxialMaterialSteel01(name, MinMaxLimit, fy, E0, b, a1, a2, a3, a4)


"""
class uniAxialMaterialSteel01(object):
    def __init__(self, matName, fy, E0, b, a1, a2, a3, a4):
        '''Generate a uniaxial Elastic Material Steel01
            link for information: https://opensees.berkeley.edu/wiki/index.php/Steel01_Material
            Inputs:
                matName: Name of the material.
                fy: yield strength [MPa].
                E0: initial elastic tangent[MPa].
                b: strain-hardening ratio (ratio between post-yield tangent and initial elastic tangent).
                a1: isotropic hardening parameter, increase of compression yield envelope as proportion of yield strength after a plastic strain of $a2*($Fy/E0). (optional).
                a2: isotropic hardening parameter (see explanation under $a1). (optional).
                a3: isotropic hardening parameter, increase of tension yield envelope as proportion of yield strength after a plastic strain of $a4*($Fy/E0). (optional)
                a4: isotropic hardening parameter (see explanation under $a3). (optional)'''

        self.matName = matName
        self.fy = fy
        self.E0 = E0
        self.b = b
        self.a1 = a1
        self.a2 = a2
        self.a3 = a3
        self.a4 = a4

        self.matTag = None

        self.materialDimension = "uniAxialMaterial"
        self.materialType = "Steel01"

    def ToString(self):
        return self.write_tcl()

    def write_tcl(self):
        if a1 != None and a2 == None and a3 == None and a4 == None:
            return "uniaxialMaterial Steel01 {} {} {} {} {}\n".format(self.matTag, self.fy, self.E0, self.b, self.a1)
        elif a1 != None and a2 != None and a3 == None and a4 == None:
            return "uniaxialMaterial Steel01 {} {} {} {} {} {}\n".format(self.matTag, self.fy, self.E0, self.b, self.a1, self.a2) 
        elif a1 != None and a2 != None and a3 != None and a4 == None:
            return "uniaxialMaterial Steel01 {} {} {} {} {} {} {}\n".format(self.matTag, self.fy, self.E0, self.b, self.a1, self.a2, self.a3) 
        elif a1 != None and a2 != None and a3 != None and a4 != None:
            return "uniaxialMaterial Steel01 {} {} {} {} {} {} {} {}\n".format(self.matTag, self.fy, self.E0, self.b, self.a1, self.a2, self.a3,  self.a4) 
        else:
            return "uniaxialMaterial Steel01 {} {} {} {}\n".format(self.matTag, self.fy, self.E0, self.b)
    def write_py(self):
        if a1 != None and a2 == None and a3 == None and a4 == None:
            return "ops.uniaxialMaterial('Steel01', {}, {}, {}, {}, {})\n".format(self.matTag, self.fy, self.E0, self.b, self.a1)
        elif a1 != None and a2 != None and a3 == None and a4 == None:
            return "ops.uniaxialMaterial('Steel01', {}, {}, {}, {}, {}, {})\n".format(self.matTag, self.fy, self.E0, self.b, self.a1, self.a2) 
        elif a1 != None and a2 != None and a3 != None and a4 == None:
            return "ops.uniaxialMaterial('Steel01', {}, {}, {}, {}, {}, {}, {})\n".format(self.matTag, self.fy, self.E0, self.b, self.a1, self.a2, self.a3) 
        elif a1 != None and a2 != None and a3 != None and a4 != None:
            return "ops.uniaxialMaterial('Steel01', {}, {}, {}, {}, {}, {}, {}, {})\n".format(self.matTag, self.fy, self.E0, self.b, self.a1, self.a2, self.a3,  self.a4) 
        else:
            return "ops.uniaxialMaterial('Steel01', {}, {}, {}, {})\n".format(self.matTag, self.fy, self.E0, self.b)
"""
# ---------- end uems01 ----------
uemrs = UniaxialElasticMaterialReinforcingSteelAlpaca4d(
    MinMaxLimit=toggle,
    fy=multiplication_13,
    fu=multiplication_5,
    Es=multiplication_14,
    Esh=panel_20,
    esh="0.001957",
    eult="0.0675")  # -> out, uniAxialMaterial; inputs MinMaxLimit: Boolean
# ---------- uemrs: Python ----------
"""
Create a uniaxial Elastic Material Reinforcing Steel
-
    Args:
        fy: Yield stress in tension
        fu: Ultimate stress in tension
        Es: Initial elastic tangent
        Esh: Tangent at initial strain hardening
        esh: Strain corresponding to initial strain hardening
        eult: Strain at peak stress
    Returns:
        uniAxialMaterial:
"""

__author__ = "Ing. Domenico Gaudioso"
__contact__ = "DomenicoGaudioso@outlook.it"
__version__ = "2021.09.17"


ghenv.Component.Name = "uniaxial Elastic Material Reinforcing Steel (Alpaca4d)"
ghenv.Component.NickName = 'UEMRS'
ghenv.Component.Message = "uniaxial Reinforcing Steel (Alpaca4d)"

import sys
import Rhino.Geometry as rg
import Grasshopper as gh
import copy


## add alpaca install directory to system path

ghcompfolder = gh.Folders.DefaultAssemblyFolder
if ghcompfolder not in sys.path:
    sys.path.append(ghcompfolder)


   
   
try:
    from Alpaca4d import alpaca4d as alpaca
except:
    msg = "Cannot import Alpaca4d. Is the Alpaca4d folder available in " + ghcompfolder + "?"
    ghenv.Component.AddRuntimeMessage(gh.Kernel.GH_RuntimeMessageLevel.Error, msg)


checkData = True

if not fy:
    checkData = False
    msg = "Input parameter fy failed to collect data"
    ghenv.Component.AddRuntimeMessage(gh.Kernel.GH_RuntimeMessageLevel.Warning, msg)

if not fu:
    checkData = False
    msg = "Input parameter fu failed to collect data"
    ghenv.Component.AddRuntimeMessage(gh.Kernel.GH_RuntimeMessageLevel.Warning, msg)
    
if not Es:
    checkData = False
    msg = "Input parameter Es failed to collect data"
    ghenv.Component.AddRuntimeMessage(gh.Kernel.GH_RuntimeMessageLevel.Warning, msg)
"""
if not Esh:
    checkData = False
    msg = "Input parameter Esh failed to collect data"
    ghenv.Component.AddRuntimeMessage(gh.Kernel.GH_RuntimeMessageLevel.Warning, msg)
"""
if not esh:
    checkData = False
    msg = "Input parameter esh failed to collect data"
    ghenv.Component.AddRuntimeMessage(gh.Kernel.GH_RuntimeMessageLevel.Warning, msg)

if not eult:
    checkData = False
    msg = "Input parameter eult failed to collect data"
    ghenv.Component.AddRuntimeMessage(gh.Kernel.GH_RuntimeMessageLevel.Warning, msg)


class uniAxialMaterialRSteel(object):
    def __init__(self, matName, MinMaxLimit, fy, fu, Es, Esh, esh, eult):
        """Generate a uniaxial Elastic Material Steel01
            link for information: https://opensees.berkeley.edu/wiki/index.php/Steel01_Material
            Inputs:
                matName: Name of the material.
                fy: Yield stress in tension
                fu: Ultimate stress in tension
                Es: Initial elastic tangent
                Esh: Tangent at initial strain hardening
                esh: Strain corresponding to initial strain hardening
                eult: Strain at peak stress
           """

        self.matName = matName
        self.MinMaxLimit = MinMaxLimit
        self.fy = fy
        self.fu = fu
        self.Es = Es
        self.Esh = Esh
        self.esh = esh
        self.eult = eult
        self.tensionLimitPositive = self.fu
        self.tensionLimitNegative = -self.fu
        self.matTag = None
        self.matTagMinMax = None
        
        self.materialDimension = "uniAxialMaterial"
        self.materialType = "Reinforcing Steel"
        

    def ToString(self):
        return self.write_tcl()

    def write_tcl(self):
        a = "uniaxialMaterial ReinforcingSteel {} {} {} {} {} {} {}\n".format(self.matTag, self.fy, self.fu, self.Es, self.Esh, self.esh, self.eult)
        b = "uniaxialMaterial MinMax {} {} -min {} -max {}\n".format(self.matTagMinMax, self.matTag, -self.eult, self.self.eult)
        if MinMaxLimit == True:
            return a + b
        else:
            return a



if checkData:
    uniAxialMaterial = uniAxialMaterialRSteel(name, MinMaxLimit, fy, fu, Es, Esh, esh, eult)


"""
class uniAxialMaterialSteel01(object):
    def __init__(self, matName, fy, E0, b, a1, a2, a3, a4):
        '''Generate a uniaxial Elastic Material Steel01
            link for information: https://opensees.berkeley.edu/wiki/index.php/Steel01_Material
            Inputs:
                matName: Name of the material.
                fy: yield strength [MPa].
                E0: initial elastic tangent[MPa].
                b: strain-hardening ratio (ratio between post-yield tangent and initial elastic tangent).
                a1: isotropic hardening parameter, increase of compression yield envelope as proportion of yield strength after a plastic strain of $a2*($Fy/E0). (optional).
                a2: isotropic hardening parameter (see explanation under $a1). (optional).
                a3: isotropic hardening parameter, increase of tension yield envelope as proportion of yield strength after a plastic strain of $a4*($Fy/E0). (optional)
                a4: isotropic hardening parameter (see explanation under $a3). (optional)'''

        self.matName = matName
        self.fy = fy
        self.E0 = E0
        self.b = b
        self.a1 = a1
        self.a2 = a2
        self.a3 = a3
        self.a4 = a4

        self.matTag = None

        self.materialDimension = "uniAxialMaterial"
        self.materialType = "Steel01"

    def ToString(self):
        return self.write_tcl()

    def write_tcl(self):
        if a1 != None and a2 == None and a3 == None and a4 == None:
            return "uniaxialMaterial Steel01 {} {} {} {} {}\n".format(self.matTag, self.fy, self.E0, self.b, self.a1)
        elif a1 != None and a2 != None and a3 == None and a4 == None:
            return "uniaxialMaterial Steel01 {} {} {} {} {} {}\n".format(self.matTag, self.fy, self.E0, self.b, self.a1, self.a2) 
        elif a1 != None and a2 != None and a3 != None and a4 == None:
            return "uniaxialMaterial Steel01 {} {} {} {} {} {} {}\n".format(self.matTag, self.fy, self.E0, self.b, self.a1, self.a2, self.a3) 
        elif a1 != None and a2 != None and a3 != None and a4 != None:
            return "uniaxialMaterial Steel01 {} {} {} {} {} {} {} {}\n".format(self.matTag, self.fy, self.E0, self.b, self.a1, self.a2, self.a3,  self.a4) 
        else:
            return "uniaxialMaterial Steel01 {} {} {} {}\n".format(self.matTag, self.fy, self.E0, self.b)
    def write_py(self):
        if a1 != None and a2 == None and a3 == None and a4 == None:
            return "ops.uniaxialMaterial('Steel01', {}, {}, {}, {}, {})\n".format(self.matTag, self.fy, self.E0, self.b, self.a1)
        elif a1 != None and a2 != None and a3 == None and a4 == None:
            return "ops.uniaxialMaterial('Steel01', {}, {}, {}, {}, {}, {})\n".format(self.matTag, self.fy, self.E0, self.b, self.a1, self.a2) 
        elif a1 != None and a2 != None and a3 != None and a4 == None:
            return "ops.uniaxialMaterial('Steel01', {}, {}, {}, {}, {}, {}, {})\n".format(self.matTag, self.fy, self.E0, self.b, self.a1, self.a2, self.a3) 
        elif a1 != None and a2 != None and a3 != None and a4 != None:
            return "ops.uniaxialMaterial('Steel01', {}, {}, {}, {}, {}, {}, {}, {})\n".format(self.matTag, self.fy, self.E0, self.b, self.a1, self.a2, self.a3,  self.a4) 
        else:
            return "ops.uniaxialMaterial('Steel01', {}, {}, {}, {})\n".format(self.matTag, self.fy, self.E0, self.b)
"""
# ---------- end uemrs ----------
# ----
uems01_2 = UniaxialElasticMaterialSteel01Alpaca4d(fy=multiplication, E0=multiplication_10, b=panel_21)  # -> out, uniAxialMaterial; inputs MinMaxLimit: Boolean
# ---------- uems01_2: Python ----------
"""
Create a uniaxial Elastic Material Concreate01
-
    Args:
        fc:
        fcu:
        ec0:
        ecu:
    Returns:
        uniAxialMaterial:
"""

ghenv.Component.Name = "uniaxial Elastic Material Steel01 (Alpaca4d)"
ghenv.Component.NickName = 'UEMS01'
ghenv.Component.Message = "uniaxial Steel01 (Alpaca4d)"

import sys
import Rhino.Geometry as rg
import Grasshopper as gh
import copy


## add alpaca install directory to system path

ghcompfolder = gh.Folders.DefaultAssemblyFolder
if ghcompfolder not in sys.path:
    sys.path.append(ghcompfolder)


   
   
try:
    from Alpaca4d import alpaca4d as alpaca
except:
    msg = "Cannot import Alpaca4d. Is the Alpaca4d folder available in " + ghcompfolder + "?"
    ghenv.Component.AddRuntimeMessage(gh.Kernel.GH_RuntimeMessageLevel.Error, msg)

print(a1!=None, a2, a3, a4)

checkData = True

if not fy:
    checkData = False
    msg = "Input parameter fy failed to collect data"
    ghenv.Component.AddRuntimeMessage(gh.Kernel.GH_RuntimeMessageLevel.Warning, msg)

if not E0:
    checkData = False
    msg = "Input parameter E0 failed to collect data"
    ghenv.Component.AddRuntimeMessage(gh.Kernel.GH_RuntimeMessageLevel.Warning, msg)
"""
if not b:
    checkData = False
    msg = "Input parameter b failed to collect data"
    ghenv.Component.AddRuntimeMessage(gh.Kernel.GH_RuntimeMessageLevel.Warning, msg)
"""

class uniAxialMaterialSteel01(object):
    def __init__(self, matName, MinMaxLimit, fy, E0, b, a1, a2, a3, a4):
        '''Generate a uniaxial Elastic Material Steel01
            link for information: https://opensees.berkeley.edu/wiki/index.php/Steel01_Material
            Inputs:
                matName: Name of the material.
                fy: yield strength [MPa].
                E0: initial elastic tangent[MPa].
                b: strain-hardening ratio (ratio between post-yield tangent and initial elastic tangent).
                a1: isotropic hardening parameter, increase of compression yield envelope as proportion of yield strength after a plastic strain of $a2*($Fy/E0). (optional).
                a2: isotropic hardening parameter (see explanation under $a1). (optional).
                a3: isotropic hardening parameter, increase of tension yield envelope as proportion of yield strength after a plastic strain of $a4*($Fy/E0). (optional)
                a4: isotropic hardening parameter (see explanation under $a3). (optional)'''

        self.matName = matName
        self.MinMaxLimit = MinMaxLimit
        self.fy = fy
        self.E0 = E0
        self.b = b
        self.a1 = a1
        self.a2 = a2
        self.a3 = a3
        self.a4 = a4
        
        self.tensionLimitPositive = self.fy
        self.tensionLimitNegative = -self.fy
        
        self.matTag = None
        self.matTagMinMax = None
        
        self.materialDimension = "uniAxialMaterial"
        self.materialType = "Steel01"
        
        self.esh = self.fy/self.E0
        self.eult = 6.75/100

    def ToString(self):
        return self.write_tcl()

    def write_tcl(self):
        if a1 != None and a2 == None and a3 == None and a4 == None:
            return "uniaxialMaterial Steel01 {} {} {} {} {}\n".format(self.matTag, self.fy, self.E0, self.b, self.a1)
        elif a1 != None and a2 != None and a3 == None and a4 == None:
            return "uniaxialMaterial Steel01 {} {} {} {} {} {}\n".format(self.matTag, self.fy, self.E0, self.b, self.a1, self.a2) 
        elif a1 != None and a2 != None and a3 != None and a4 == None:
            return "uniaxialMaterial Steel01 {} {} {} {} {} {} {}\n".format(self.matTag, self.fy, self.E0, self.b, self.a1, self.a2, self.a3) 
        elif a1 == None and a2 == None and a3 == None and a4 == None and self.MinMaxLimit== None:
            return "uniaxialMaterial Steel01 {} {} {} {}\n".format(self.matTag, self.fy, self.E0, self.b) 
        elif self.a1 == None and self.a2 == None and self.a3 == None and self.a4 == None and self.MinMaxLimit== True:            
            a = "uniaxialMaterial Steel01 {} {} {} {}\n".format(self.matTag, self.fy, self.E0, self.b)
            b = "uniaxialMaterial MinMax {} {} -min {} -max {}\n".format(self.matTagMinMax, self.matTag, -self.eult, self.eult)
            return a + b
    def write_py(self):
        if a1 != None and a2 == None and a3 == None and a4 == None:
            return "ops.uniaxialMaterial('Steel01', {}, {}, {}, {}, {})\n".format(self.matTag, self.fy, self.E0, self.b, self.a1)
        elif a1 != None and a2 != None and a3 == None and a4 == None:
            return "ops.uniaxialMaterial('Steel01', {}, {}, {}, {}, {}, {})\n".format(self.matTag, self.fy, self.E0, self.b, self.a1, self.a2) 
        elif a1 != None and a2 != None and a3 != None and a4 == None:
            return "ops.uniaxialMaterial('Steel01', {}, {}, {}, {}, {}, {}, {})\n".format(self.matTag, self.fy, self.E0, self.b, self.a1, self.a2, self.a3) 
        elif a1 != None and a2 != None and a3 != None and a4 != None:
            return "ops.uniaxialMaterial('Steel01', {}, {}, {}, {}, {}, {}, {}, {})\n".format(self.matTag, self.fy, self.E0, self.b, self.a1, self.a2, self.a3,  self.a4) 
        else:
            return "ops.uniaxialMaterial('Steel01', {}, {}, {}, {})\n".format(self.matTag, self.fy, self.E0, self.b)


if checkData:
    uniAxialMaterial = uniAxialMaterialSteel01(name, MinMaxLimit, fy, E0, b, a1, a2, a3, a4)


"""
class uniAxialMaterialSteel01(object):
    def __init__(self, matName, fy, E0, b, a1, a2, a3, a4):
        '''Generate a uniaxial Elastic Material Steel01
            link for information: https://opensees.berkeley.edu/wiki/index.php/Steel01_Material
            Inputs:
                matName: Name of the material.
                fy: yield strength [MPa].
                E0: initial elastic tangent[MPa].
                b: strain-hardening ratio (ratio between post-yield tangent and initial elastic tangent).
                a1: isotropic hardening parameter, increase of compression yield envelope as proportion of yield strength after a plastic strain of $a2*($Fy/E0). (optional).
                a2: isotropic hardening parameter (see explanation under $a1). (optional).
                a3: isotropic hardening parameter, increase of tension yield envelope as proportion of yield strength after a plastic strain of $a4*($Fy/E0). (optional)
                a4: isotropic hardening parameter (see explanation under $a3). (optional)'''

        self.matName = matName
        self.fy = fy
        self.E0 = E0
        self.b = b
        self.a1 = a1
        self.a2 = a2
        self.a3 = a3
        self.a4 = a4

        self.matTag = None

        self.materialDimension = "uniAxialMaterial"
        self.materialType = "Steel01"

    def ToString(self):
        return self.write_tcl()

    def write_tcl(self):
        if a1 != None and a2 == None and a3 == None and a4 == None:
            return "uniaxialMaterial Steel01 {} {} {} {} {}\n".format(self.matTag, self.fy, self.E0, self.b, self.a1)
        elif a1 != None and a2 != None and a3 == None and a4 == None:
            return "uniaxialMaterial Steel01 {} {} {} {} {} {}\n".format(self.matTag, self.fy, self.E0, self.b, self.a1, self.a2) 
        elif a1 != None and a2 != None and a3 != None and a4 == None:
            return "uniaxialMaterial Steel01 {} {} {} {} {} {} {}\n".format(self.matTag, self.fy, self.E0, self.b, self.a1, self.a2, self.a3) 
        elif a1 != None and a2 != None and a3 != None and a4 != None:
            return "uniaxialMaterial Steel01 {} {} {} {} {} {} {} {}\n".format(self.matTag, self.fy, self.E0, self.b, self.a1, self.a2, self.a3,  self.a4) 
        else:
            return "uniaxialMaterial Steel01 {} {} {} {}\n".format(self.matTag, self.fy, self.E0, self.b)
    def write_py(self):
        if a1 != None and a2 == None and a3 == None and a4 == None:
            return "ops.uniaxialMaterial('Steel01', {}, {}, {}, {}, {})\n".format(self.matTag, self.fy, self.E0, self.b, self.a1)
        elif a1 != None and a2 != None and a3 == None and a4 == None:
            return "ops.uniaxialMaterial('Steel01', {}, {}, {}, {}, {}, {})\n".format(self.matTag, self.fy, self.E0, self.b, self.a1, self.a2) 
        elif a1 != None and a2 != None and a3 != None and a4 == None:
            return "ops.uniaxialMaterial('Steel01', {}, {}, {}, {}, {}, {}, {})\n".format(self.matTag, self.fy, self.E0, self.b, self.a1, self.a2, self.a3) 
        elif a1 != None and a2 != None and a3 != None and a4 != None:
            return "ops.uniaxialMaterial('Steel01', {}, {}, {}, {}, {}, {}, {}, {})\n".format(self.matTag, self.fy, self.E0, self.b, self.a1, self.a2, self.a3,  self.a4) 
        else:
            return "ops.uniaxialMaterial('Steel01', {}, {}, {}, {})\n".format(self.matTag, self.fy, self.E0, self.b)
"""
# ---------- end uems01_2 ----------
panel_22 = Panel(uems01.uniAxialMaterial)
panel_23 = Panel(uemc01.uniAxialMaterial)
P = PathAlpaca4d(
    material=uems01.uniAxialMaterial,
    polyC=[item_4.Item2, item_4.Item3],
    U=Slider(2, range=0..100),
    V=Slider(8, range=0..10))  # -> out, path, pathSurf; inputs polyC: Curve, U: Int32, V: Int32
# ---------- P: Python ----------
"""
Create path
-
    Args:
        material: material component.
        polyC: polyline with 4 node (only 4 node).
        U:  number of subdivisions (fibers) in the IJ direction.
        V: 	number of subdivisions (fibers) in the JK direction.
            Inputs:
                
                
                
            
    Returns:
        uniAxialMaterial:
"""

ghenv.Component.Name = "path (Alpaca4d)"
ghenv.Component.NickName = 'P'
ghenv.Component.Message = "path (Alpaca4d)"

import sys
import Rhino.Geometry as rg
import Grasshopper as gh
import copy


## add alpaca install directory to system path

ghcompfolder = gh.Folders.DefaultAssemblyFolder
if ghcompfolder not in sys.path:
    sys.path.append(ghcompfolder)

try:
    from Alpaca4d import alpaca4d as alpaca
except:
    msg = "Cannot import Alpaca4d. Is the Alpaca4d folder available in " + ghcompfolder + "?"
    ghenv.Component.AddRuntimeMessage(gh.Kernel.GH_RuntimeMessageLevel.Error, msg)


checkData = True

if not material:
    checkData = False
    msg = "Input parameter material failed to collect data"
    ghenv.Component.AddRuntimeMessage(gh.Kernel.GH_RuntimeMessageLevel.Warning, msg)

if not polyC:
    checkData = False
    msg = "Input parameter polyC failed to collect data"
    ghenv.Component.AddRuntimeMessage(gh.Kernel.GH_RuntimeMessageLevel.Warning, msg)

if not U:
    checkData = False
    msg = "Input parameter U failed to collect data"
    ghenv.Component.AddRuntimeMessage(gh.Kernel.GH_RuntimeMessageLevel.Warning, msg)

if not V:
    checkData = False
    msg = "Input parameter V failed to collect data"
    ghenv.Component.AddRuntimeMessage(gh.Kernel.GH_RuntimeMessageLevel.Warning, msg)

import rhinoscriptsyntax as rs
import Rhino.Geometry as rg
import ghpythonlib.components as ghcomp

#a = rg.Mesh.CreateFromSurface(surf4N, rg.MeshingParameters.Default)


class path(object):
    def __init__(self, material, polyC, U, V):
        """ Generate fiber
            link for information: https://opensees.berkeley.edu/wiki/index.php/Patch_Command
            Inputs:
                matName: Name of the material.
                U:  number of subdivisions (fibers) in the IJ direction.
                V: 	number of subdivisions (fibers) in the JK direction.
        """
        
        self.material = material
        self.polyC = polyC
        self.U = U 
        self.V = V
        
        self.Point = [polyC.Point(i) for i in range(0,4)]
        # Da perfezionare per far avere sempre la stessa direzione
        if self.Point[0].X <= self.Point[1].X:
            print("direction mesh is good")
            
        else:
            print( "non va bene" )
            self.Point.reverse()
            
        self.surf = ghcomp.MeshSurface(polyC, self.U, self.V, True, True)

    def ToString(self):
        return self.write_tcl()

    def write_tcl(self):
        return "patch quad {} {} {} {} {} {} {} {} {} {} {};\n".format(self.material.matTag, self.U, self.V, self.Point[0].X, self.Point[0].Y, self.Point[1].X, self.Point[1].Y, self.Point[2].X, self.Point[2].Y, self.Point[3].X, self.Point[3].Y  )

if checkData:
    mat = copy.copy(material)
    path = path(mat, polyC, U, V)
    pathSurf = path.surf
# ---------- end P ----------
f = FiberAlpaca4d(material=uemc01.uniAxialMaterial, point=area_3.Centroid, area=area_3.Area)  # -> out, fiber; inputs point: Point3d
# ---------- f: Python ----------
"""
Create fiber
-
    Args:
        material: material component.
        point: point
        area:  area
            Inputs:
                
                
                
            
    Returns:
        uniAxialMaterial:
"""

ghenv.Component.Name = "fiber (Alpaca4d)"
ghenv.Component.NickName = 'f'
ghenv.Component.Message = "fiber (Alpaca4d)"

import sys
import Rhino.Geometry as rg
import Grasshopper as gh
import copy


## add alpaca install directory to system path

ghcompfolder = gh.Folders.DefaultAssemblyFolder
if ghcompfolder not in sys.path:
    sys.path.append(ghcompfolder)

try:
    from Alpaca4d import alpaca4d as alpaca
except:
    msg = "Cannot import Alpaca4d. Is the Alpaca4d folder available in " + ghcompfolder + "?"
    ghenv.Component.AddRuntimeMessage(gh.Kernel.GH_RuntimeMessageLevel.Error, msg)


checkData = True

if not material:
    checkData = False
    msg = "Input parameter material failed to collect data"
    ghenv.Component.AddRuntimeMessage(gh.Kernel.GH_RuntimeMessageLevel.Warning, msg)

if not point:
    checkData = False
    msg = "Input parameter point failed to collect data"
    ghenv.Component.AddRuntimeMessage(gh.Kernel.GH_RuntimeMessageLevel.Warning, msg)

if not area:
    checkData = False
    msg = "Input parameter area failed to collect data"
    ghenv.Component.AddRuntimeMessage(gh.Kernel.GH_RuntimeMessageLevel.Warning, msg)

import rhinoscriptsyntax as rs
import Rhino.Geometry as rg
import ghpythonlib.components as ghcomp

#a = rg.Mesh.CreateFromSurface(surf4N, rg.MeshingParameters.Default)


class fiber(object):
    def __init__(self, material, point, area):
        """ Generate fiber
            link for information: https://opensees.berkeley.edu/wiki/index.php/Patch_Command
            Inputs:
                matName: Name of the material.
                point:  
                area: 	
        """
        
        self.material = material
        self.point = point
        self.area = area 
        
            
        #self.surf = ghcomp.MeshSurface(polyC, self.U, self.V, True, True)

    def ToString(self):
        return self.write_tcl()

    def write_tcl(self):
        return "fiber {} {} {} {};\n".format(self.point.X, self.point.Y, self.area, self.material.matTag)

if checkData:
    mat = copy.copy(material)
    fiber = fiber(mat, point, area)
# ---------- end f ----------
P_2 = PathAlpaca4d(material=uems01.uniAxialMaterial, polyC=cluster, U=Slider(50, range=0..100), V=Slider(10, range=0..10))  # -> out, path, pathSurf; inputs polyC: Curve, U: Int32, V: Int32; same code as P
panel_24 = Panel(P_2.path)
P_3 = PathAlpaca4d(material=uemc01.uniAxialMaterial, polyC=crv_6, U=Slider(10, range=0..100), V=Slider(10, range=0..100))  # -> out, path, pathSurf; inputs polyC: Curve, U: Int32, V: Int32
# ---------- P_3: Python ----------
"""
Create path
-
    Args:
        material: material component.
        polyC: polyline with 4 node (only 4 node).
        U:  number of subdivisions (fibers) in the IJ direction.
        V: 	number of subdivisions (fibers) in the JK direction.
            Inputs:
                
                
                
            
    Returns:
        uniAxialMaterial:
"""

__author__ = "Ing. Domenico Gaudioso"
__contact__ = "DomenicoGaudioso@outlook.it"
__version__ = "2021.09.17"

ghenv.Component.Name = "path (Alpaca4d)"
ghenv.Component.NickName = 'P'
ghenv.Component.Message = "path (Alpaca4d)"

import sys
import Rhino.Geometry as rg
import Grasshopper as gh
import copy


## add alpaca install directory to system path

ghcompfolder = gh.Folders.DefaultAssemblyFolder
if ghcompfolder not in sys.path:
    sys.path.append(ghcompfolder)

try:
    from Alpaca4d import alpaca4d as alpaca
except:
    msg = "Cannot import Alpaca4d. Is the Alpaca4d folder available in " + ghcompfolder + "?"
    ghenv.Component.AddRuntimeMessage(gh.Kernel.GH_RuntimeMessageLevel.Error, msg)


checkData = True

if not material:
    checkData = False
    msg = "Input parameter material failed to collect data"
    ghenv.Component.AddRuntimeMessage(gh.Kernel.GH_RuntimeMessageLevel.Warning, msg)

if not polyC:
    checkData = False
    msg = "Input parameter polyC failed to collect data"
    ghenv.Component.AddRuntimeMessage(gh.Kernel.GH_RuntimeMessageLevel.Warning, msg)

if not U:
    checkData = False
    msg = "Input parameter U failed to collect data"
    ghenv.Component.AddRuntimeMessage(gh.Kernel.GH_RuntimeMessageLevel.Warning, msg)

if not V:
    checkData = False
    msg = "Input parameter V failed to collect data"
    ghenv.Component.AddRuntimeMessage(gh.Kernel.GH_RuntimeMessageLevel.Warning, msg)

import rhinoscriptsyntax as rs
import Rhino.Geometry as rg
import ghpythonlib.components as ghcomp

#a = rg.Mesh.CreateFromSurface(surf4N, rg.MeshingParameters.Default)


class path(object):
    def __init__(self, material, polyC, U, V):
        """ Generate fiber
            link for information: https://opensees.berkeley.edu/wiki/index.php/Patch_Command
            Inputs:
                matName: Name of the material.
                U:  number of subdivisions (fibers) in the IJ direction.
                V: 	number of subdivisions (fibers) in the JK direction.
        """
        
        self.material = material
        self.polyC = polyC
        self.U = U 
        self.V = V
        
        self.Point = [polyC.Point(i) for i in range(0,4)]
        # Da perfezionare per far avere sempre la stessa direzione
        if self.Point[0].X <= self.Point[1].X:
            print("direction mesh is good")
            
        else:
            print( "non va bene" )
            self.Point.reverse()
            
        self.surf = ghcomp.MeshSurface(polyC, self.U, self.V, True, True)

    def ToString(self):
        return self.write_tcl()

    def write_tcl(self):
        return "patch quad {} {} {} {} {} {} {} {} {} {} {};\n".format(self.material.matTag, self.U, self.V, self.Point[0].X, self.Point[0].Y, self.Point[1].X, self.Point[1].Y, self.Point[2].X, self.Point[2].Y, self.Point[3].X, self.Point[3].Y  )

if checkData:
    mat = copy.copy(material)
    path = path(mat, polyC, U, V)
    pathSurf = path.surf
# ---------- end P_3 ----------
P_4 = PathAlpaca4d(material=uemc01.uniAxialMaterial, polyC=cluster_4.polyc_2, U=Slider(10, range=0..100), V=Slider(50, range=0..100))  # -> out, path, pathSurf; inputs polyC: Curve, U: Int32, V: Int32; same code as P
mcol_2 = MeshColours(Mesh=P_4.pathSurf, Colours=ColourSwatch(SwatchColor=RGBA(249, 255, 84, 120)))
facen_2 = FaceNormals(Mesh=P_4.pathSurf)  # -> Centers, Normals
item_9 = ListItem(List=facen_2.Centers, Index=0, Wrap=True)  # -> Item, Item1
panel_25 = Panel(facen_2.Centers)

number_slider_33 = Slider(8, range=0..100)
number_slider_34 = Slider(10, range=0..10)
l = LayerAlpaca4d(material=uems01_2.uniAxialMaterial, line=crv, nBar=Slider(10, range=0..10), diameter=number_slider_33)  # -> out, layer, layerCircle; inputs line: Curve, nBar: Int32, diameter: Int32
# ---------- l: Python ----------
"""
Create path
-
    Args:
        material: material component.
        polyC: polyline with 4 node (only 4 node).
        nBar:  number of fibers along line
        diameter: 	diameter bar (mm)
            Inputs:
                
                
                
            
    Returns:
        uniAxialMaterial:
"""

ghenv.Component.Name = "layer (Alpaca4d)"
ghenv.Component.NickName = 'l'
ghenv.Component.Message = "layer (Alpaca4d)"

import sys
import Rhino.Geometry as rg
import Grasshopper as gh
import copy


## add alpaca install directory to system path

ghcompfolder = gh.Folders.DefaultAssemblyFolder
if ghcompfolder not in sys.path:
    sys.path.append(ghcompfolder)

try:
    from Alpaca4d import alpaca4d as alpaca
except:
    msg = "Cannot import Alpaca4d. Is the Alpaca4d folder available in " + ghcompfolder + "?"
    ghenv.Component.AddRuntimeMessage(gh.Kernel.GH_RuntimeMessageLevel.Error, msg)


checkData = True

if not material:
    checkData = False
    msg = "Input parameter material failed to collect data"
    ghenv.Component.AddRuntimeMessage(gh.Kernel.GH_RuntimeMessageLevel.Warning, msg)

if not line:
    checkData = False
    msg = "Input parameter line failed to collect data"
    ghenv.Component.AddRuntimeMessage(gh.Kernel.GH_RuntimeMessageLevel.Warning, msg)

if not nBar:
    checkData = False
    msg = "Input parameter nBar failed to collect data"
    ghenv.Component.AddRuntimeMessage(gh.Kernel.GH_RuntimeMessageLevel.Warning, msg)

if not diameter:
    checkData = False
    msg = "Input parameter diameter failed to collect data"
    ghenv.Component.AddRuntimeMessage(gh.Kernel.GH_RuntimeMessageLevel.Warning, msg)

import rhinoscriptsyntax as rs
import Rhino.Geometry as rg
import math as mt
import ghpythonlib.components as ghcomp

#a = rg.Mesh.CreateFromSurface(surf4N, rg.MeshingParameters.Default)


class layer(object):
    def __init__(self, material, line, nBar, diameter):
        """ Generate fiber
            link for information: https://opensees.berkeley.edu/wiki/index.php/Layer_Command
            Inputs:
                matName: Name of the material.
                nBar:  number of fibers along line
        """
        
        self.material = material
        self.line = line
        self.nBar = nBar 
        self.diameter = diameter/1000
        
        area = mt.pi*self.diameter**2/4
        self.Atot = area#*self.nBar 
        pAt = self.line.DivideByCount(self.nBar - 1, True)
        self.Point = [ self.line.PointAt(pAt[i]) for i in range(len(pAt))]
        self.layerSurf = [ rg.Circle(iPoint, self.diameter/2) for iPoint in self.Point ]
        
        

    def ToString(self):
        return self.write_tcl()

    def write_tcl(self):
        return "layer straight {} {} {} {} {} {} {};\n".format(self.material.matTag, self.nBar, self.Atot, self.line.PointAtStart.X, self.line.PointAtStart.Y, self.line.PointAtEnd.X, self.line.PointAtEnd.Y )


if checkData:
    mat = copy.copy(material)
    layer = layer(mat, line, nBar, diameter)
    layerCircle = layer.layerSurf
# ---------- end l ----------
l_2 = LayerAlpaca4d(material=uems01_2.uniAxialMaterial, line=explode_4.Segments, nBar=panel_3, diameter=Slider(20, range=0..100))  # -> out, layer, layerCircle; inputs line: Curve, nBar: Int32, diameter: Int32
# ---------- l_2: Python ----------
"""
Create path
-
    Args:
        material: material component.
        polyC: polyline with 4 node (only 4 node).
        nBar:  number of fibers along line
        diameter: 	diameter bar (mm)
            Inputs:
                
                
                
            
    Returns:
        uniAxialMaterial:
"""

ghenv.Component.Name = "layer (Alpaca4d)"
ghenv.Component.NickName = 'l'
ghenv.Component.Message = "layer (Alpaca4d)"

import sys
import Rhino.Geometry as rg
import Grasshopper as gh
import copy


## add alpaca install directory to system path

ghcompfolder = gh.Folders.DefaultAssemblyFolder
if ghcompfolder not in sys.path:
    sys.path.append(ghcompfolder)

try:
    from Alpaca4d import alpaca4d as alpaca
except:
    msg = "Cannot import Alpaca4d. Is the Alpaca4d folder available in " + ghcompfolder + "?"
    ghenv.Component.AddRuntimeMessage(gh.Kernel.GH_RuntimeMessageLevel.Error, msg)


checkData = True

if not material:
    checkData = False
    msg = "Input parameter material failed to collect data"
    ghenv.Component.AddRuntimeMessage(gh.Kernel.GH_RuntimeMessageLevel.Warning, msg)

if not line:
    checkData = False
    msg = "Input parameter line failed to collect data"
    ghenv.Component.AddRuntimeMessage(gh.Kernel.GH_RuntimeMessageLevel.Warning, msg)

if not nBar:
    checkData = False
    msg = "Input parameter nBar failed to collect data"
    ghenv.Component.AddRuntimeMessage(gh.Kernel.GH_RuntimeMessageLevel.Warning, msg)

if not diameter:
    checkData = False
    msg = "Input parameter diameter failed to collect data"
    ghenv.Component.AddRuntimeMessage(gh.Kernel.GH_RuntimeMessageLevel.Warning, msg)

import rhinoscriptsyntax as rs
import Rhino.Geometry as rg
import math as mt
import ghpythonlib.components as ghcomp

#a = rg.Mesh.CreateFromSurface(surf4N, rg.MeshingParameters.Default)


class layer(object):
    def __init__(self, material, line, nBar, diameter):
        """ Generate fiber
            link for information: https://opensees.berkeley.edu/wiki/index.php/Layer_Command
            Inputs:
                matName: Name of the material.
                nBar:  number of fibers along line
        """
        
        self.material = material
        self.line = line
        self.nBar = nBar 
        self.diameter = diameter/1000
        
        area = (mt.pi*self.diameter**2/4)
        self.Atot = area #*self.nBar 
        pAt = self.line.DivideByCount(self.nBar - 1, True)
        self.Point = [ self.line.PointAt(pAt[i]) for i in range(len(pAt))]
        self.layerSurf = [ rg.Circle(iPoint, self.diameter/2) for iPoint in self.Point ]
        
        

    def ToString(self):
        return self.write_tcl()

    def write_tcl(self):
        return "layer straight {} {} {} {} {} {} {};\n".format(self.material.matTag, self.nBar, self.Atot, self.line.PointAtStart.X, self.line.PointAtStart.Y, self.line.PointAtEnd.X, self.line.PointAtEnd.Y )


if checkData:
    mat = copy.copy(material)
    layer = layer(mat, line, nBar, diameter)
    layerCircle = layer.layerSurf
# ---------- end l_2 ----------

division_4 = Division(A=number_slider_33, B=Slider(1000, range=0..1000))
srf_2 = Surface(l.layerCircle)
addition_2 = Addition(A=number_slider_6, B=division_4)
python_2 = GhPythonScript(path=flatten(P_4.path), layer=flatten(l.layer))  # -> out, FiberSection, FiberMesh, PropSection; inputs fiber: list, path: list, layer: list
# ---------- python_2: Python ----------
__author__ = "Domen"
__version__ = "2021.08.07"

import rhinoscriptsyntax as rs
import ghpythonlib.components as ghcomp
import Rhino.Geometry as rg
import math as mt

"""
for i, item in enumerate(path):
    print(i, item)
    item.material.matTag = i + 1
"""

class FiberSection(object):
    def __init__(self, fiber, path, layer):
        
        self.fiber = fiber
        self.path = path
        self.layer = layer
        self.secTag = None

        self.mesh = []
        for item in path:
            self.mesh.append(item.surf)
        self.mesh = ghcomp.Kangaroo2Component.CombineClean(self.mesh)
        calculateProp = rg.AreaMassProperties.Compute(self.mesh)
        self.centerSection = calculateProp.Centroid
        self.Area = calculateProp.Area
        
        NuPositive = []
        NuNegative = []
        for item in self.path:
            area = rg.AreaMassProperties.Compute(item.surf).Area
            NuPositive.append( area*item.material.tensionLimitPositive )
            NuNegative.append( area*item.material.tensionLimitNegative )
            
            
        for item in self.layer:
            area = item.Atot*item.nBar
            NuPositive.append( area*item.material.tensionLimitPositive )
            NuNegative.append( area*item.material.tensionLimitNegative )
            
        for item in self.fiber:
            NuPositive.append( item.area*item.material.tensionLimitPositive )
            NuNegative.append( item.area*item.material.tensionLimitNegative )
            
        self.NultNeg = sum(NuNegative)
        self.NultPos = sum(NuPositive)
        # calcolo proprietà della sezione #
        area = 'Area: ' + str(self.Area)  + '\n'
        centroidC = 'Centroid coordinates: ' + "x: {}, y: {}, z: {} ".format(self.centerSection.X, self.centerSection.Y, self.centerSection.Z) + '\n'
        Inertia = calculateProp.CentroidCoordinatesMomentsOfInertia
        InertiaStr = 'Inertia respect the centroid : ' + "Ixx: {}, Iyy: {}, Izz: {} ".format(Inertia.X, Inertia.Y, Inertia.Z) + '\n'
        Nultimo = 'Axial Force ultimate: ' + str([self.NultNeg, self.NultPos])  + '\n'
        self.prop = ''.join([area, centroidC, InertiaStr, Nultimo ])
        

    def ToString(self):
        return self.write_tcl()

    def write_tcl(self):
        section = "section Fiber {} -GJ 10000 {}\n".format(self.secTag, "{;") # -GJ 10000
        # FIBER
        fiberList = ''.join([ i.ToString() for i in self.fiber ])
        # PATH
        pathList = ''.join([ i.ToString() for i in self.path ])
        # LAYER
        layerList = ''.join([ i.ToString() for i in self.layer ])
        
        return section + fiberList + pathList + layerList +"}\n"

    def write_py(self):
        py_text = "ops.section('Elastic',{},{},{},{},{},{},{},{},{})\n".format(self.sectionTag, self.material.E, self.Area, self.Izz, self.Iyy, self.material.G, self.J, self.alphaY, self.alphaZ)
        return py_text


FiberSection = FiberSection(fiber, path, layer)
FiberMesh = FiberSection.mesh
PropSection = FiberSection.prop
print( FiberSection.ToString() )
# ---------- end python_2 ----------
panel_26 = Panel(python_2.PropSection)

number_slider_35 = Slider(50, range=0..100)
neg_8 = Negative(Value=Slider(11437, range=0..100000))
mnm_2 = MNModelAlpaca4d(FiberSection=python_2.FiberSection, N=neg_8, M1=neg_5, M2=Slider(0, range=0..100), Pout=facen_2.Centers)  # -> out, N, M1; inputs centerForce: Point3d, Pout: Point3d
# ---------- mnm_2: Python ----------
"""
Run an OpenSees Analysis
-
    Args:
        FiberSection:
        direction: 1 for M2 and 2 for M1. Default is 1 
        nPoint: number of Point for make de N-M domain
    Returns:
        N: axial load valor
        M: bending moment valor
"""



import Rhino.RhinoDoc
import Grasshopper as gh
import copy
import rhinoscriptsyntax as rs
import Rhino.Geometry as rg
import os
import time
import sys
import subprocess
import ghpythonlib.treehelpers as th
import math as mt
import ghpythonlib.parallel as ghp



ghenv.Component.Name = "M-N Model (Alpaca4d)"
ghenv.Component.NickName = 'MNM'
ghenv.Component.Message = "M-N Model (Alpaca4d)"

ghcompfolder = gh.Folders.DefaultAssemblyFolder
if ghcompfolder not in sys.path:
    sys.path.append(ghcompfolder)

try:
    from Alpaca4d import alpaca4d as alpaca
except:
    msg = "Cannot import Alpaca4d. Is the Alpaca4d folder available in " + ghcompfolder + "?"
    ghenv.Component.AddRuntimeMessage(gh.Kernel.GH_RuntimeMessageLevel.Error, msg)


checkData = True



if not FiberSection:
    checkData = False
    msg = "Input parameter AlpacaModel failed to collect data"
    ghenv.Component.AddRuntimeMessage(gh.Kernel.GH_RuntimeMessageLevel.Warning, msg)

if centerForce == None:
    centerForce = rg.Point3d(FiberSection.centerSection.X, FiberSection.centerSection.Y, FiberSection.centerSection.Z)

if Pout == None:
    Pout = rg.Point3d(FiberSection.centerSection.X, FiberSection.centerSection.Y, FiberSection.centerSection.Z)
    
class MomentCurvature(object):
    def __init__(self, recorderName, section, cForce, axialLoad, M1, M2, pointOut):
        #^ y
        #|
        #|
        #|------> x
        self.recorderName = recorderName
        self.section = section
        self.cForce = cForce
        self.axialLoad = axialLoad
        self.M1 = M1
        self.M2 = M2
        self.pointOut = pointOut
        self.secTag = 1

    def ToString(self):
        return self.write_tcl()

    def write_tcl(self):
        # Define two nodes at (0,0)
        clean = "wipe\n"
        model = "model BasicBuilder -ndm 3 -ndf 6\n"
        
        materialPath = ''.join([ i.material.write_tcl() for i in self.section.path ])
        materialLayer = ''.join([ i.material.write_tcl() for i in self.section.layer ])
        material = materialPath + materialLayer
        
        section = self.section.ToString()
        node1 = "node {} {} {} {}\n".format(1, self.cForce.X, self.cForce.Y, self.cForce.Z)
        node2 = "node {} {} {} {}\n".format(2, self.cForce.X, self.cForce.Y, self.cForce.Z)
        # Fix all degrees of freedom except axial and bending
        fix1 = "fix {} {} {} {} {} {} {}\n".format(1, 1, 1, 1, 1 ,1, 1) #node tag Fx Fy Fz Mx My Mz
        fix2 = "fix {} {} {} {} {} {} {}\n".format(2, 0, 1, 1, 1, 0, 0) #node tag Fx Fy Fz Mx My Mz
        # Define element
        ele = "element zeroLengthSection {} {} {} {}\n".format( 1, 1, 2, self.secTag) #-orient 1 0 0 1 0 0
        # Define constant axial load
        pattern = 'pattern Plain {} "{}" {}\n'.format( 1, 'Constant', "{;")   
        load = "load {} {} {} {} {} {} {};\n".format(2, self.axialLoad, 0.0, 0.0, 0.0, self.M1, self.M2) +  "}\n" 
        # analysis for constant axial load
        Integrator = "integrator LoadControl {}\n".format( 1)
        System = "system BandGeneral\n" #-piv
        Test = "test NormUnbalance {} {}\n".format( 1e-10, 1000)
        number = "numberer RCM\n"
        constraints = "constraints Plain\n"
        algorithm = "algorithm Newton\n"
        analysis = "analysis Static\n"
        # Do one analysis for constant axial load
        analyze = "analyze {}\n".format(1) 
        lC = "wipe\n"
        # Define reference moment 
        recorder1 = "recorder Element -file {} -ele 1 section fiber {} {} stressStrain\n".format(self.recorderName, self.pointOut.X, self.pointOut.Y )
        #recorder2 = "recorder mpco Data.mpco -E force\n"  # "recorder Element -file {} -ele 1 section fiber 0.03 0.035 stressStrain\n".format(self.recorderName)
        #recorder2 = "recorder Element -file {} -ele 1 section deformation\n".format(recorderName2)
        
        return clean + model + material + section +  node1 + node2 + fix1 + fix2 + ele + pattern + load + Integrator + recorder1 + System + Test + number + constraints + algorithm + analysis + analyze +lC


if checkData:
    FiberSection.secTag = 1
    for i, item in enumerate(FiberSection.path):
        item.material.matTag = i + 1
        #print(item.material.matTag )
    j = i+2
    for i, item in enumerate(FiberSection.layer):
        item.material.matTag = j + i
        #print(j+i)
    w = j+2
    for i, item in enumerate(FiberSection.fiber):
        item.material.matTag = w + i
        

recorderFileName = "DataTensionSection.out"
outputFileName = "ModelTensionSection.txt"
        
            
MC = MomentCurvature(recorderFileName, FiberSection, centerForce, N, M1, M2, Pout) 
script = MC.write_tcl()

FolderPath = rs.DocumentPath()
os.chdir(FolderPath)
    

runFileName = os.path.join(FolderPath,outputFileName)

filepath = os.path.join(FolderPath,recorderFileName)

time_start = time.clock()

with open(outputFileName, 'w') as f:
    for line in MC.write_tcl():
        f.write(line)
    f.close()

time_elapsed = (time.clock() - time_start)
#print("Writing Time {}".format(time_elapsed))

time_start = time.clock()

executable = os.path.join(ghcompfolder,'Alpaca4d\OpenSees-Solvers\opensees.bat')
#executable = os.path.join(ghcompfolder,'C:\OpenSees\bin\opensees.bat')

#process = subprocess.Popen([r'C:\OpenSees\bin\OpenSees', outputFileName], shell = True, stdout=subprocess.PIPE, stderr=subprocess.PIPE)
process = subprocess.Popen([executable, outputFileName], shell = True,  stdout=subprocess.PIPE, stderr=subprocess.PIPE)
stdout, stderr = process.communicate()
print(stderr)
process.kill()

time_elapsed = (time.clock() - time_start)
print("Analyses Time {}".format(time_elapsed))
#filepath = os.path.join(r'C:\OpenSees\bin',recorderFileName)

fileObj = open(filepath, 'r')
words = fileObj.read().splitlines(" ")
#print(fileObj.read())
N = "None"
if len(words) != 0:
    N = float(words[-1].split()[0])
    M1 = float(words[-1].split()[1])
fileObj.close()
# ---------- end mnm_2 ----------

panel_27 = Panel(python_2.out)
mnm_3 = MNModelAlpaca4d(FiberSection=python_2.FiberSection, direction=Slider(1, range=0..10), nPoint=Slider(20, range=0..1000))  # -> out, N, M; inputs centerForce: Point3d, nPoint: Int32
# ---------- mnm_3: Python ----------
"""
Run an OpenSees Analysis
-
    Args:
        FiberSection:
        direction: 1 for M2 and 2 for M1. Default is 1 
        nPoint: number of Point for make de N-M domain
    Returns:
        N: axial load valor
        M: bending moment valor
"""



import Rhino.RhinoDoc
import Grasshopper as gh
import copy
import rhinoscriptsyntax as rs
import Rhino.Geometry as rg
import os
import time
import sys
import subprocess
import ghpythonlib.treehelpers as th
import math as mt
import ghpythonlib.parallel as ghp



ghenv.Component.Name = "M-N Model (Alpaca4d)"
ghenv.Component.NickName = 'MNM'
ghenv.Component.Message = "M-N Model (Alpaca4d)"

ghcompfolder = gh.Folders.DefaultAssemblyFolder
if ghcompfolder not in sys.path:
    sys.path.append(ghcompfolder)

try:
    from Alpaca4d import alpaca4d as alpaca
except:
    msg = "Cannot import Alpaca4d. Is the Alpaca4d folder available in " + ghcompfolder + "?"
    ghenv.Component.AddRuntimeMessage(gh.Kernel.GH_RuntimeMessageLevel.Error, msg)


checkData = True



if not FiberSection:
    checkData = False
    msg = "Input parameter AlpacaModel failed to collect data"
    ghenv.Component.AddRuntimeMessage(gh.Kernel.GH_RuntimeMessageLevel.Warning, msg)
if direction == None:
    direction = 1

if centerForce == None:
    centerForce = rg.Point3d(FiberSection.centerSection.X, FiberSection.centerSection.Y, FiberSection.centerSection.Z)
"""
class MomentCurvature(object):
    def __init__(self, recorderName, section, axialLoad, valorMfix, direction, maxPhi, cForce, numIncr=100):
        #^ y
        #|
        #|
        #|------> x
        self.recorderName = recorderName
        self.section = section
        self.axialLoad = axialLoad
        self.valorMfix = valorMfix
        self.direction = direction
        self.maxPhi = maxPhi
        self.cForce = cForce
        self.numIncr= numIncr
        # Compute curvature increment
        #self.dK = self.maxK / self.numIncr
        self.secTag = 1
        

    def ToString(self):
        return self.write_tcl()

    def write_tcl(self):
        # Define two nodes at (0,0)
        clean = "wipe\n"
        model = "model BasicBuilder -ndm 3 -ndf 6\n"
        
        materialFiber = ''.join([ i.material.write_tcl() for i in self.section.fiber ])
        materialPath = ''.join([ i.material.write_tcl() for i in self.section.path ])
        materialLayer = ''.join([ i.material.write_tcl() for i in self.section.layer ])
        material = materialFiber + materialPath + materialLayer
        
        section = self.section.ToString()
        node1 = "node {} {} {} {}\n".format(1, self.cForce.X, self.cForce.Y, self.cForce.Z)
        node2 = "node {} {} {} {}\n".format(2, self.cForce.X, self.cForce.Y, self.cForce.Z)
        # Fix all degrees of freedom except axial and bending
        fix1 = "fix {} {} {} {} {} {} {}\n".format(1, 1, 1, 1, 1 ,1, 1) #node tag Fx Fy Fz Mx My Mz
        fix2 = "fix {} {} {} {} {} {} {}\n".format(2, 0, 1, 1, 1, 0, 0) #node tag Fx Fy Fz Mx My Mz
        # Define element
        ele = "element zeroLengthSection {} {} {} {}\n".format( 1, 1, 2, self.secTag) #-orient 1 0 0 1 0 0
        # Define constant axial load
        pattern = 'pattern Plain {} "{}" {}\n'.format( 1, 'Constant', "{;")   
        load = "load {} {} {} {} {} {} {};\n".format(2, self.axialLoad, 0.0, 0.0, 0.0, 0.0, 0.0) +  "}\n" 
        # analysis for constant axial load
        Integrator = "integrator LoadControl {}\n".format( 0.1)
        System = "system BandGeneral\n" #-piv
        Test = "test NormUnbalance {} {}\n".format( 1e-10, 1000)
        number = "numberer RCM\n"
        constraints = "constraints Plain\n"
        algorithm = "algorithm Newton\n"
        analysis = "analysis Static\n"
        # Do one analysis for constant axial load
        analyze = "analyze {}\n".format(10) 
        lC = "loadConst -time 0.0\n"
        # Define reference moment 
        recorderName1 = self.recorderName + "Force" + ".out"
        recorderName2 = self.recorderName + "Disp" + ".out"
        recorder1 = "recorder Element -file {} -ele 1 section force\n".format(recorderName1)
        #recorder2 = "recorder Element -file {} -ele 1 section deformation\n".format(recorderName2)
        patternM = 'pattern Plain {} "{}" {}\n'.format( 2, 'Linear', "{;")   
        # Use displacement control at node 2 for section analysis
        #IntegratorD = "integrator DisplacementControl {} {} {} {} {} {}\n".format(2,3,0.00035,1,self.dK,self.dK)
        if self.direction == 1 and self.maxPhi >0:
            directionID = 5
            loadM = "load {} {} {} {} {} {} {};\n".format(2, 0.0, 0.0, 0.0, 0.0, self.direction, self.valorMfix) +  "}\n"
            
        elif self.direction == 2 and self.maxPhi >0:
            directionID = 6
            loadM = "load {} {} {} {} {} {} {};\n".format(2, 0.0, 0.0, 0.0, 0.0, self.valorMfix, self.direction) +  "}\n" 
            
        elif self.direction == 1 and self.maxPhi <0:
            directionID = 5
            loadM = "load {} {} {} {} {} {} {};\n".format(2, 0.0, 0.0, 0.0, 0.0, -self.direction, self.valorMfix) +  "}\n" 
            
        elif self.direction == 2 and self.maxPhi <0:
            directionID = 6
            loadM = "load {} {} {} {} {} {} {};\n".format(2, 0.0, 0.0, 0.0, 0.0, self.valorMfix, -self.direction) +  "}\n" 
            
        IntegratorD = "integrator DisplacementControl {} {} {} {}\n".format(2,directionID,self.maxPhi/self.numIncr, 100) #node dof incr numIter
        #IntegratorD = 'integrator ' + self.Integrator.ToString() + "\n"
        analyze2 = "analyze {}\n".format(self.numIncr) + "\n" + "wipe"+ "\n"

        analyze2 = "set ok [analyze {}]\n".format(self.numIncr) #+ "\n" + "wipe"+ "\n"
        A = "set IDctrlNode 2\n" 
        B = "set IDctrlDOF 6\n"
        C = "set Dmax {}\n".format(self.maxPhi)
        D = "set Dincr {}\n".format(self.maxPhi/self.numIncr)
        E = "set TolStatic {}\n".format(1.e-9)
        F = "set testTypeStatic EnergyIncr \n"
        G = "set maxNumIterStatic {}\n".format(11)
        H = "set algorithmTypeStatic Newton\n"
        #source = "wipe\n"
        source = "source C:/Users/Domen/Desktop/Alpaca MC/aaa.txt\n"

        #return clean + model + material + section +  node1 + node2 + fix1 + fix2 + ele + pattern + load + Integrator + System + Test + number + constraints + algorithm + analysis + analyze +lC + recorder1 + patternM + loadM + IntegratorD + analyze2 + A + B + C + D + E + F + G + H + source
        return clean + model + material + section +  node1 + node2 + fix1 + fix2 + ele + pattern + load + Integrator + System + Test + number + constraints + algorithm + analysis + analyze +lC + recorder1 + patternM + loadM + IntegratorD + analyze2


    def write_py(self):
        # Define two nodes at (0,0)


        return node1 + node2 + fix1 + fix2 + ele  + timeSeries + pattern + load + Integrator + System + test + number + constraints + algorithm + analysis + analyze + timeSeriesM + patternM + loadM + IntegratorD + analyze2
"""
class MomentCurvature(object):
    def __init__(self, recorderName, section, axialLoad, alpha, maxPhi, numIncr=100):
        #^ y
        #|
        #|
        #|------> x
        self.recorderName = recorderName
        self.section = section
        self.axialLoad = axialLoad
        self.alpha = mt.radians(alpha)
        self.maxPhi = maxPhi
        self.numIncr= numIncr
        # Compute curvature increment
        #self.dK = self.maxK / self.numIncr
        self.secTag = 1
        

    def ToString(self):
        return self.write_tcl()

    def write_tcl(self):
        # Define two nodes at (0,0)
        clean = "wipe\n"
        model = "model BasicBuilder -ndm 3 -ndf 6\n"
        
        materialFiber = ''.join([ i.material.write_tcl() for i in self.section.fiber ])
        materialPath = ''.join([ i.material.write_tcl() for i in self.section.path ])
        materialLayer = ''.join([ i.material.write_tcl() for i in self.section.layer ])
        material = materialFiber + materialPath + materialLayer
        
        section = self.section.ToString()
        node1 = "node {} {} {} {}\n".format(1, 0.0, 0.0, 0.0)
        node2 = "node {} {} {} {}\n".format(2, 0.0, 0.0, 0.0)
        # Fix all degrees of freedom except axial and bending
        fix1 = "fix {} {} {} {} {} {} {}\n".format(1, 1, 1, 1, 1 ,1, 1) #node tag Fx Fy Fz Mx My Mz
        fix2 = "fix {} {} {} {} {} {} {}\n".format(2, 0, 1, 1, 1, 0, 0) #node tag Fx Fy Fz Mx My Mz
        # Define element
        ele = "element zeroLengthSection {} {} {} {} -orient 1 0 0 0 {} {}\n".format( 1, 1, 2, self.secTag, mt.cos(self.alpha), mt.sin(self.alpha)) #-orient 1 0 0 0 $cos $sin
        # Define constant axial load
        pattern = 'pattern Plain {} "{}" {}\n'.format( 1, 'Constant', "{;")   
        load = "load {} {} {} {} {} {} {};\n".format(2, self.axialLoad, 0.0, 0.0, 0.0, 0.0, 0.0) +  "}\n" 
        # analysis for constant axial load
        Integrator = "integrator LoadControl {}\n".format( 0.1)
        System = "system BandGeneral\n" #-piv
        Test = "test NormUnbalance {} {}\n".format( 1e-10, 1000)
        number = "numberer RCM\n"
        constraints = "constraints Plain\n"
        algorithm = "algorithm Newton\n"
        analysis = "analysis Static\n"
        # Do one analysis for constant axial load
        analyze = "analyze {}\n".format(10) 
        lC = "loadConst -time 0.0\n"
        # Define reference moment 
        recorderName1 = self.recorderName + "Force" + ".out"
        recorderName2 = self.recorderName + "Disp" + ".out"
        recorder1 = "recorder Element -file {} -ele 1 section force\n".format(recorderName1)
        #recorder2 = "recorder Element -file {} -ele 1 section deformation\n".format(recorderName2)
        patternM = 'pattern Plain {} "{}" {}\n'.format( 2, 'Linear', "{;")   
        # Use displacement control at node 2 for section analysis
        loadM = "load {} {} {} {} {} {} {};\n".format(2, 0.0, 0.0, 0.0, 0.0, 1.0, 0.0) +  "}\n" 
        IntegratorD = "integrator DisplacementControl {} {} {}\n".format(2, 5, self.maxPhi/self.numIncr)
        #IntegratorD = 'integrator ' + self.Integrator.ToString() + "\n"
        analyze2 = "analyze {}\n".format(self.numIncr) + "\n" + "wipe"+ "\n"

        return clean + model + material + section +  node1 + node2 + fix1 + fix2 + ele + pattern + load + Integrator + System + Test + number + constraints + algorithm + analysis + analyze +lC + recorder1 + patternM + loadM + IntegratorD + analyze2


def RunMCpositive(Pi): 
    if Pi > 0.0:
        recorderFileName = "MKsectionP{}positiveMpositive".format(int(mt.fabs(Pi)))
        outputFileName = "OSSModel{}positiveMpositive".format(int(mt.fabs(Pi)))
    elif Pi < 0.0:
        recorderFileName = "MKsectionP{}negativeMpositive".format(int(mt.fabs(Pi)))
        outputFileName = "OSSModel{}negativeMpositive".format(int(mt.fabs(Pi)))
        
    if direction == 1:
        alpha = 0.0
    else:
        alpha = 90.0
            
    MC = MomentCurvature(recorderFileName,FiberSection, float(Pi), alpha, 2.0, 1000) #mu*FiberSection.Ky
    script = MC.write_tcl()
    
    FolderPath = rs.DocumentPath()
    os.chdir(FolderPath)
        
    recorderFileName1 = recorderFileName + "Force" + ".out"
    recorderFileName2 = recorderFileName + "Disp" + ".out"
    
    runFileName = os.path.join(FolderPath,outputFileName)
    filepath1 = os.path.join(FolderPath,recorderFileName1)
    #filepath2 = os.path.join(FolderPath,recorderFileName2)
    """
    if os.path.exists(runFileName):
      os.remove(runFileName)
      os.remove(filepath1)
      os.remove(filepath1)
    else:
      print("The file does not exist")
    """
    time_start = time.clock()
    
    with open(outputFileName, 'w') as f:
        for line in MC.write_tcl():
            f.write(line)
        f.close()
    
    time_elapsed = (time.clock() - time_start)
    #print("Writing Time {}".format(time_elapsed))
    
    time_start = time.clock()
    
    executable = os.path.join(ghcompfolder,'Alpaca4d\OpenSees-Solvers\opensees.bat')
    #executable = os.path.join(ghcompfolder,'C:\OpenSees\bin\opensees.bat')
    
    #process = subprocess.Popen([r'C:\OpenSees\bin\OpenSees', outputFileName], shell = True, stdout=subprocess.PIPE, stderr=subprocess.PIPE)
    process = subprocess.Popen([executable, outputFileName], shell = True,  stdout=subprocess.PIPE, stderr=subprocess.PIPE)
    stdout, stderr = process.communicate()
    #print(stdout, stderr)
    process.kill()
    os.remove(runFileName)
    time_elapsed = (time.clock() - time_start)
    #print("Analyses Time {}".format(time_elapsed))
    #filepath = os.path.join(r'C:\OpenSees\bin',recorderFileName)
    fileObj = open(filepath1, 'r')
    words = fileObj.read().splitlines(" ")
    #print(fileObj.read())
    N = "None"
    if len(words) != 0:
        N = float(words[-1].split()[0])
        M1 = float(words[-1].split()[1])
        M2 = float(words[-1].split()[2])
    fileObj.close()

    os.remove(filepath1)
    """
    fileObj = open(filepath2, 'r')
    words = fileObj.read().splitlines(" ")
    #print(fileObj.read())

    k1 = [ float(i.split()[1]) for i in words]
    k2 = [ float(i.split()[2]) for i in words]
    k3 = [ float(i.split()[3]) for i in words]
    fileObj.close()
    """
    #os.remove(filepath2)
    if N != "None" :
        return [N, M1, M2]


def RunMCnegative(Pi): 

    if Pi > 0.0:
        recorderFileName = "MKsectionP{}positiveMnegative".format(int(mt.fabs(Pi)))
        outputFileName = "OSSModel{}positiveMnegative".format(int(mt.fabs(Pi)))
    elif Pi < 0.0:
        recorderFileName = "MKsectionP{}negativeMnegative".format(int(mt.fabs(Pi)))
        outputFileName = "OSSModel{}negativeMnegative".format(int(mt.fabs(Pi)))
        
    if direction == 1:
        alpha = 180.00
    else:
        alpha = 270.00
            
    MC = MomentCurvature(recorderFileName,FiberSection, float(Pi), alpha, 2.0, 1000)
    script = MC.write_tcl()
    
    FolderPath = rs.DocumentPath()
    os.chdir(FolderPath)
        
    recorderFileName1 = recorderFileName + "Force" + ".out"
    recorderFileName2 = recorderFileName + "Disp" + ".out"
    
    runFileName = os.path.join(FolderPath,outputFileName)
    filepath1 = os.path.join(FolderPath,recorderFileName1)
    #filepath2 = os.path.join(FolderPath,recorderFileName2)
    """
    if os.path.exists(runFileName):
      os.remove(runFileName)
      os.remove(filepath1)
      os.remove(filepath1)
    else:
      print("The file does not exist")
      """
    time_start = time.clock()
    
    with open(outputFileName, 'w') as f:
        for line in MC.write_tcl():
            f.write(line)
        f.close()
    
    time_elapsed = (time.clock() - time_start)
    #print("Writing Time {}".format(time_elapsed))
    
    time_start = time.clock()
    
    executable = os.path.join(ghcompfolder,'Alpaca4d\OpenSees-Solvers\opensees.bat')
    #executable = os.path.join(ghcompfolder,'C:\OpenSees\bin\opensees.bat')
    
    #process = subprocess.Popen([r'C:\OpenSees\bin\OpenSees', outputFileName], shell = True, stdout=subprocess.PIPE, stderr=subprocess.PIPE)
    process = subprocess.Popen([executable, outputFileName], shell = True,  stdout=subprocess.PIPE, stderr=subprocess.PIPE)
    stdout, stderr = process.communicate()
    #print(stdout, stderr)
    process.kill()
    os.remove(runFileName)
    time_elapsed = (time.clock() - time_start)
    #print("Analyses Time {}".format(time_elapsed))
    #filepath = os.path.join(r'C:\OpenSees\bin',recorderFileName)
    fileObj = open(filepath1, 'r')
    words = fileObj.read().splitlines(" ")
    #print(fileObj.read())
    N = "None"
    if len(words) != 0:
        N = float(words[-1].split()[0])
        M1 = float(words[-1].split()[1])
        M2 = float(words[-1].split()[2])
    fileObj.close()

    os.remove(filepath1)
    """
    fileObj = open(filepath2, 'r')
    words = fileObj.read().splitlines(" ")
    #print(fileObj.read())

    k1 = [ float(i.split()[1]) for i in words]
    k2 = [ float(i.split()[2]) for i in words]
    k3 = [ float(i.split()[3]) for i in words]
    fileObj.close()
    """
    #os.remove(filepath2)
    if N != "None" :
        return [N, M1, M2]
        
        

        
if checkData:
    FiberSection.secTag = 1
    for i, item in enumerate(FiberSection.path):
        item.material.matTag = 2*(i+1)
        item.material.matTagMinMax = 2*i+1
        #print(item.material.matTag )
    j = i+2
    for i, item in enumerate(FiberSection.layer):
        j = j + i 
        item.material.matTag = 2*(j+1)
        item.material.matTagMinMax = 2*j+1
        #print(j+i)
    w = j+2
    for i, item in enumerate(FiberSection.fiber):
        w = w + i 
        item.material.matTag = 2*(w+1)
        item.material.matTagMinMax = 2*w+1
        
#A = ghp.run(RunNEps,[-1.0, 1.0], True)


def linspace(start, stop, len):
    step = (mt.fabs(start)+stop)/(len-1)
    return [start + step*interval for interval in range(len)]
    
print(FiberSection.NultNeg+0.1*FiberSection.NultNeg,FiberSection.NultPos)


#n1 = int(mt.fabs(min(A)/stepValorPositive))
#n2 = int(mt.fabs(max(A)/stepValorNegative))

#listP = linspace(min(A), -5.0, n1) + linspace(5, max(A)-10.0, n2)

if nPoint == None:
    nPoint = 10
    
listP = linspace(FiberSection.NultNeg,FiberSection.NultPos, nPoint)


B = ghp.run(RunMCpositive, listP,False)
C = ghp.run(RunMCnegative, listP,False)

#print(D[7])
#RunM1Cpositive(Pi): 


Nupos, Nuneg = [], []
M1uP, M2uP = [], []
M1uN, M2uN = [], []

B =filter(None, B) #elimino il None
C =filter(None, C) 

for item in B:
    Nupos.append(item[0])
    M1uP.append( item[1])
    M2uP.append( item[2])
    #M3uP.append( item[3])
    
for item in C:
    Nuneg.append(item[0])
    M1uN.append( item[1])
    M2uN.append( item[2])

M1 = M1uN + M1uP[::-1] + M1uN[0:1]
M2 = M2uN + M2uP[::-1] + M2uN[0:1]
N = Nuneg + Nupos[::-1] + Nuneg[0:1]

if direction == 1:
    M = M2
else:
    M = M1
# ---------- end mnm_3 ----------
dm1m2_2 = DomainM1M2Alpaca4d(FiberSection=python_2.FiberSection, nPoint=Slider(36, range=0..100))  # -> out, N, M1, M2; inputs nPoint: Int32
# ---------- dm1m2_2: Python ----------
"""
Run an OpenSees Analysis
-
    Args:
        FiberSection:
        direction: 1 for M2 and 2 for M1. Default is 1 
        nPoint: number of Point for make de N-M domain
    Returns:
        N: axial load valor
        M: bending moment valor
"""



import Rhino.RhinoDoc
import Grasshopper as gh
import copy
import rhinoscriptsyntax as rs
import Rhino.Geometry as rg
import os
import time
import sys
import subprocess
import ghpythonlib.treehelpers as th
import math as mt
import ghpythonlib.parallel as ghp



ghenv.Component.Name = "Domain M1 M2 (Alpaca4d)"
ghenv.Component.NickName = 'DM1M2'
ghenv.Component.Message = "Domain M1 M2 (Alpaca4d)"

ghcompfolder = gh.Folders.DefaultAssemblyFolder
if ghcompfolder not in sys.path:
    sys.path.append(ghcompfolder)

try:
    from Alpaca4d import alpaca4d as alpaca
except:
    msg = "Cannot import Alpaca4d. Is the Alpaca4d folder available in " + ghcompfolder + "?"
    ghenv.Component.AddRuntimeMessage(gh.Kernel.GH_RuntimeMessageLevel.Error, msg)


checkData = True



if not FiberSection:
    checkData = False
    msg = "Input parameter AlpacaModel failed to collect data"
    ghenv.Component.AddRuntimeMessage(gh.Kernel.GH_RuntimeMessageLevel.Warning, msg)


"""
class MomentCurvature(object):
    def __init__(self, recorderName, section, axialLoad, valorMfix, direction, maxPhi, cForce, numIncr=100):
        #^ y
        #|
        #|
        #|------> x
        self.recorderName = recorderName
        self.section = section
        self.axialLoad = axialLoad
        self.valorMfix = valorMfix
        self.direction = direction
        self.maxPhi = maxPhi
        self.cForce = cForce
        self.numIncr= numIncr
        # Compute curvature increment
        #self.dK = self.maxK / self.numIncr
        self.secTag = 1
        

    def ToString(self):
        return self.write_tcl()

    def write_tcl(self):
        # Define two nodes at (0,0)
        clean = "wipe\n"
        model = "model BasicBuilder -ndm 3 -ndf 6\n"
        
        materialFiber = ''.join([ i.material.write_tcl() for i in self.section.fiber ])
        materialPath = ''.join([ i.material.write_tcl() for i in self.section.path ])
        materialLayer = ''.join([ i.material.write_tcl() for i in self.section.layer ])
        material = materialFiber + materialPath + materialLayer
        
        section = self.section.ToString()
        node1 = "node {} {} {} {}\n".format(1, self.cForce.X, self.cForce.Y, self.cForce.Z)
        node2 = "node {} {} {} {}\n".format(2, self.cForce.X, self.cForce.Y, self.cForce.Z)
        # Fix all degrees of freedom except axial and bending
        fix1 = "fix {} {} {} {} {} {} {}\n".format(1, 1, 1, 1, 1 ,1, 1) #node tag Fx Fy Fz Mx My Mz
        fix2 = "fix {} {} {} {} {} {} {}\n".format(2, 0, 1, 1, 1, 0, 0) #node tag Fx Fy Fz Mx My Mz
        # Define element
        ele = "element zeroLengthSection {} {} {} {}\n".format( 1, 1, 2, self.secTag) #-orient 1 0 0 1 0 0
        # Define constant axial load
        pattern = 'pattern Plain {} "{}" {}\n'.format( 1, 'Constant', "{;")   
        load = "load {} {} {} {} {} {} {};\n".format(2, self.axialLoad, 0.0, 0.0, 0.0, 0.0, 0.0) +  "}\n" 
        # analysis for constant axial load
        Integrator = "integrator LoadControl {}\n".format( 0.1)
        System = "system BandGeneral\n" #-piv
        Test = "test NormUnbalance {} {}\n".format( 1e-10, 1000)
        number = "numberer RCM\n"
        constraints = "constraints Plain\n"
        algorithm = "algorithm Newton\n"
        analysis = "analysis Static\n"
        # Do one analysis for constant axial load
        analyze = "analyze {}\n".format(10) 
        lC = "loadConst -time 0.0\n"
        # Define reference moment 
        recorderName1 = self.recorderName + "Force" + ".out"
        recorderName2 = self.recorderName + "Disp" + ".out"
        recorder1 = "recorder Element -file {} -ele 1 section force\n".format(recorderName1)
        #recorder2 = "recorder Element -file {} -ele 1 section deformation\n".format(recorderName2)
        patternM = 'pattern Plain {} "{}" {}\n'.format( 2, 'Linear', "{;")   
        # Use displacement control at node 2 for section analysis
        #IntegratorD = "integrator DisplacementControl {} {} {} {} {} {}\n".format(2,3,0.00035,1,self.dK,self.dK)
        if self.direction == 1 and self.maxPhi >0:
            directionID = 5
            loadM = "load {} {} {} {} {} {} {};\n".format(2, 0.0, 0.0, 0.0, 0.0, self.direction, self.valorMfix) +  "}\n"
            
        elif self.direction == 2 and self.maxPhi >0:
            directionID = 6
            loadM = "load {} {} {} {} {} {} {};\n".format(2, 0.0, 0.0, 0.0, 0.0, self.valorMfix, self.direction) +  "}\n" 
            
        elif self.direction == 1 and self.maxPhi <0:
            directionID = 5
            loadM = "load {} {} {} {} {} {} {};\n".format(2, 0.0, 0.0, 0.0, 0.0, -self.direction, self.valorMfix) +  "}\n" 
            
        elif self.direction == 2 and self.maxPhi <0:
            directionID = 6
            loadM = "load {} {} {} {} {} {} {};\n".format(2, 0.0, 0.0, 0.0, 0.0, self.valorMfix, -self.direction) +  "}\n" 
            
        IntegratorD = "integrator DisplacementControl {} {} {} {}\n".format(2,directionID,self.maxPhi/self.numIncr, 100) #node dof incr numIter
        #IntegratorD = 'integrator ' + self.Integrator.ToString() + "\n"
        analyze2 = "analyze {}\n".format(self.numIncr) + "\n" + "wipe"+ "\n"

        analyze2 = "set ok [analyze {}]\n".format(self.numIncr) #+ "\n" + "wipe"+ "\n"
        A = "set IDctrlNode 2\n" 
        B = "set IDctrlDOF 6\n"
        C = "set Dmax {}\n".format(self.maxPhi)
        D = "set Dincr {}\n".format(self.maxPhi/self.numIncr)
        E = "set TolStatic {}\n".format(1.e-9)
        F = "set testTypeStatic EnergyIncr \n"
        G = "set maxNumIterStatic {}\n".format(11)
        H = "set algorithmTypeStatic Newton\n"
        #source = "wipe\n"
        source = "source C:/Users/Domen/Desktop/Alpaca MC/aaa.txt\n"

        #return clean + model + material + section +  node1 + node2 + fix1 + fix2 + ele + pattern + load + Integrator + System + Test + number + constraints + algorithm + analysis + analyze +lC + recorder1 + patternM + loadM + IntegratorD + analyze2 + A + B + C + D + E + F + G + H + source
        return clean + model + material + section +  node1 + node2 + fix1 + fix2 + ele + pattern + load + Integrator + System + Test + number + constraints + algorithm + analysis + analyze +lC + recorder1 + patternM + loadM + IntegratorD + analyze2


    def write_py(self):
        # Define two nodes at (0,0)


        return node1 + node2 + fix1 + fix2 + ele  + timeSeries + pattern + load + Integrator + System + test + number + constraints + algorithm + analysis + analyze + timeSeriesM + patternM + loadM + IntegratorD + analyze2
"""
def linspace(start, stop, len):
    step = (mt.fabs(start)+stop)/(len-1)
    return [start + step*interval for interval in range(len)]
    
class MomentCurvature(object):
    def __init__(self, recorderName, section, axialLoad, alpha, maxPhi, numIncr=100):
        #^ y
        #|
        #|
        #|------> x
        self.recorderName = recorderName
        self.section = section
        self.axialLoad = axialLoad
        self.alpha = mt.radians(alpha)
        self.maxPhi = maxPhi
        self.numIncr= numIncr
        # Compute curvature increment
        #self.dK = self.maxK / self.numIncr
        self.secTag = 1
        

    def ToString(self):
        return self.write_tcl()

    def write_tcl(self):
        # Define two nodes at (0,0)
        clean = "wipe\n"
        model = "model BasicBuilder -ndm 3 -ndf 6\n"
        
        materialFiber = ''.join([ i.material.write_tcl() for i in self.section.fiber ])
        materialPath = ''.join([ i.material.write_tcl() for i in self.section.path ])
        materialLayer = ''.join([ i.material.write_tcl() for i in self.section.layer ])
        material = materialFiber + materialPath + materialLayer
        
        section = self.section.ToString()
        node1 = "node {} {} {} {}\n".format(1, self.section.centerSection.X, self.section.centerSection.Y, self.section.centerSection.Z)
        node2 = "node {} {} {} {}\n".format(2, self.section.centerSection.X, self.section.centerSection.Y, self.section.centerSection.Z)
        # Fix all degrees of freedom except axial and bending
        fix1 = "fix {} {} {} {} {} {} {}\n".format(1, 1, 1, 1, 1 ,1, 1) #node tag Fx Fy Fz Mx My Mz
        fix2 = "fix {} {} {} {} {} {} {}\n".format(2, 0, 1, 1, 1, 0, 0) #node tag Fx Fy Fz Mx My Mz
        # Define element
        ele = "element zeroLengthSection {} {} {} {} -orient 1 0 0 0 {} {}\n".format( 1, 1, 2, self.secTag, mt.cos(self.alpha), mt.sin(self.alpha)) #-orient 1 0 0 0 $cos $sin
        # Define constant axial load
        pattern = 'pattern Plain {} "{}" {}\n'.format( 1, 'Constant', "{;")   
        load = "load {} {} {} {} {} {} {};\n".format(2, self.axialLoad, 0.0, 0.0, 0.0, 0.0, 0.0) +  "}\n" 
        # analysis for constant axial load
        Integrator = "integrator LoadControl {}\n".format( 0.1)
        System = "system BandGeneral\n" #-piv
        Test = "test NormUnbalance {} {}\n".format( 1e-10, 1000)
        number = "numberer RCM\n"
        constraints = "constraints Plain\n"
        algorithm = "algorithm Newton\n"
        analysis = "analysis Static\n"
        # Do one analysis for constant axial load
        analyze = "analyze {}\n".format(10) 
        lC = "loadConst -time 0.0\n"
        # Define reference moment 
        recorderName1 = self.recorderName + "Force" + ".out"
        recorderName2 = self.recorderName + "Disp" + ".out"
        recorder1 = "recorder Element -file {} -ele 1 section force\n".format(recorderName1)
        #recorder2 = "recorder Element -file {} -ele 1 section deformation\n".format(recorderName2)
        patternM = 'pattern Plain {} "{}" {}\n'.format( 2, 'Linear', "{;")   
        # Use displacement control at node 2 for section analysis
        loadM = "load {} {} {} {} {} {} {};\n".format(2, 0.0, 0.0, 0.0, 0.0, 1.0, 0.0) +  "}\n" 
        IntegratorD = "integrator DisplacementControl {} {} {}\n".format(2, 5, self.maxPhi/self.numIncr)
        #IntegratorD = 'integrator ' + self.Integrator.ToString() + "\n"
        analyze2 = "analyze {}\n".format(self.numIncr) + "\n" + "wipe"+ "\n"

        return clean + model + material + section +  node1 + node2 + fix1 + fix2 + ele + pattern + load + Integrator + System + Test + number + constraints + algorithm + analysis + analyze +lC + recorder1 + patternM + loadM + IntegratorD + analyze2


def RunMCpositive(Pi): 
    if Pi > 0.0:
        recorderFileName = "MKsectionP{}positiveMpositive".format(int(mt.fabs(Pi)))
        outputFileName = "OSSModel{}positiveMpositive".format(int(mt.fabs(Pi)))
    elif Pi < 0.0:
        recorderFileName = "MKsectionP{}negativeMpositive".format(int(mt.fabs(Pi)))
        outputFileName = "OSSModel{}negativeMpositive".format(int(mt.fabs(Pi)))
    
    if nPoint == None:
        alpha = linspace(0,360, 36)
    else :
        alpha = linspace(0,360, nPoint)
   
        
    listN = []
    listM1 = []
    listM2 = []
    for alphai in alpha:
        MC = MomentCurvature(recorderFileName,FiberSection, float(Pi), alphai, 2.0, 1000) #mu*FiberSection.Ky
        script = MC.write_tcl()
    
        FolderPath = rs.DocumentPath()
        os.chdir(FolderPath)
        
        recorderFileName1 = recorderFileName + "Force" + ".out"
        recorderFileName2 = recorderFileName + "Disp" + ".out"
    
        runFileName = os.path.join(FolderPath,outputFileName)
        filepath1 = os.path.join(FolderPath,recorderFileName1)
        #filepath2 = os.path.join(FolderPath,recorderFileName2)
        time_start = time.clock()
    
        with open(outputFileName, 'w') as f:
            for line in MC.write_tcl():
                f.write(line)
            f.close()
    
        time_elapsed = (time.clock() - time_start)
        #print("Writing Time {}".format(time_elapsed))
        
        time_start = time.clock()
        
        executable = os.path.join(ghcompfolder,'Alpaca4d\OpenSees-Solvers\opensees.bat')
        #executable = os.path.join(ghcompfolder,'C:\OpenSees\bin\opensees.bat')
        
        #process = subprocess.Popen([r'C:\OpenSees\bin\OpenSees', outputFileName], shell = True, stdout=subprocess.PIPE, stderr=subprocess.PIPE)
        process = subprocess.Popen([executable, outputFileName], shell = True,  stdout=subprocess.PIPE, stderr=subprocess.PIPE)
        stdout, stderr = process.communicate()
        #print(stdout, stderr)
        process.kill()
        os.remove(runFileName)
        time_elapsed = (time.clock() - time_start)
        #print("Analyses Time {}".format(time_elapsed))
        #filepath = os.path.join(r'C:\OpenSees\bin',recorderFileName)
        fileObj = open(filepath1, 'r')
        words = fileObj.read().splitlines(" ")
        #print(fileObj.read())
        N = "None"
        if len(words) != 0:
            N = float(words[-1].split()[0])
            M1 = float(words[-1].split()[1])
            M2 = float(words[-1].split()[2])
            
            listN.append(N)
            listM1.append(M1)
            listM2.append(M2)
        fileObj.close()

        os.remove(filepath1)
    """
    fileObj = open(filepath2, 'r')
    words = fileObj.read().splitlines(" ")
    #print(fileObj.read())

    k1 = [ float(i.split()[1]) for i in words]
    k2 = [ float(i.split()[2]) for i in words]
    k3 = [ float(i.split()[3]) for i in words]
    fileObj.close()
    """
        #os.remove(filepath2)
    if N != "None" :
        return [listN, listM1, listM2]


        
        

        
if checkData:
    FiberSection.secTag = 1
    for i, item in enumerate(FiberSection.path):
        item.material.matTag = 2*(i+1)
        item.material.matTagMinMax = 2*i+1
        #print(item.material.matTag )
    j = i+2
    for i, item in enumerate(FiberSection.layer):
        j = j + i 
        item.material.matTag = 2*(j+1)
        item.material.matTagMinMax = 2*j+1
        #print(j+i)
    w = j+2
    for i, item in enumerate(FiberSection.fiber):
        w = w + i 
        item.material.matTag = 2*(w+1)
        item.material.matTagMinMax = 2*w+1
        
#A = ghp.run(RunNEps,[-1.0, 1.0], True)



    
print(FiberSection.NultNeg+0.1*FiberSection.NultNeg,FiberSection.NultPos)


#n1 = int(mt.fabs(min(A)/stepValorPositive))
#n2 = int(mt.fabs(max(A)/stepValorNegative))

#listP = linspace(min(A), -5.0, n1) + linspace(5, max(A)-10.0, n2)


if axialLoad == None:
    axialLoad = 0.1
B = ghp.run(RunMCpositive, [axialLoad],False)
B =filter(None, B)
#C = ghp.run(RunMCnegative, listP,False)

#print(B[1])
#RunM1Cpositive(Pi): 

N, M1, M2 = [], [], []

for item in B:
    #item =filter(None, item) #elimino il None
    N.append(item[0])
    M1.append(item[1])
    M2.append(item[2])


N, M1, M2 = th.list_to_tree(N), th.list_to_tree(M1), th.list_to_tree(M2)



"""
for item in B:
    Nupos.append(item[0])
    M1uP.append( item[1])
    M2uP.append( item[2])
    #M3uP.append( item[3])
    
for item in C:
    Nuneg.append(item[0])
    M1uN.append( item[1])
    M2uN.append( item[2])

M1 = M1uN + M1uP[::-1] + M1uN[0:1]
M2 = M2uN + M2uP[::-1] + M2uN[0:1]
N = Nuneg + Nupos[::-1] + Nuneg[0:1]

if direction == 1:
    M = M2
else:
    M = M1
"""
# ---------- end dm1m2_2 ----------
_3dd_2 = _3DDomainAlpaca4d(FiberSection=python_2.FiberSection, nPoint=number_slider_22)  # -> out, N, M1, M2; inputs nPoint: Int32
# ---------- _3dd_2: Python ----------
"""
Run an OpenSees Analysis
-
    Args:
        FiberSection:
        direction: 1 for M2 and 2 for M1. Default is 1 
        nPoint: number of Point for make de N-M domain
    Returns:
        N: axial load valor
        M: bending moment valor
"""



import Rhino.RhinoDoc
import Grasshopper as gh
import copy
import rhinoscriptsyntax as rs
import Rhino.Geometry as rg
import os
import time
import sys
import subprocess
import ghpythonlib.treehelpers as th
import math as mt
import ghpythonlib.parallel as ghp


__author__ = "Ing. Domenico Gaudioso"
__contact__ = "DomenicoGaudioso@outlook.it"
__version__ = "2021.09.17"

ghenv.Component.Name = "3D Domain (Alpaca4d)"
ghenv.Component.NickName = '3DD'
ghenv.Component.Message = "3D Domain (Alpaca4d)"

ghcompfolder = gh.Folders.DefaultAssemblyFolder
if ghcompfolder not in sys.path:
    sys.path.append(ghcompfolder)

try:
    from Alpaca4d import alpaca4d as alpaca
except:
    msg = "Cannot import Alpaca4d. Is the Alpaca4d folder available in " + ghcompfolder + "?"
    ghenv.Component.AddRuntimeMessage(gh.Kernel.GH_RuntimeMessageLevel.Error, msg)


checkData = True



if not FiberSection:
    checkData = False
    msg = "Input parameter AlpacaModel failed to collect data"
    ghenv.Component.AddRuntimeMessage(gh.Kernel.GH_RuntimeMessageLevel.Warning, msg)

def linspace(start, stop, len):
    step = (mt.fabs(start)+stop)/(len-1)
    return [start + step*interval for interval in range(len)]

def RunMCpositive(Pi): 
    if Pi > 0.0:
        recorderFileName = "MKsectionP{}positiveMpositive".format(int(mt.fabs(Pi)))
        outputFileName = "OSSModel{}positiveMpositive".format(int(mt.fabs(Pi)))
    elif Pi < 0.0:
        recorderFileName = "MKsectionP{}negativeMpositive".format(int(mt.fabs(Pi)))
        outputFileName = "OSSModel{}negativeMpositive".format(int(mt.fabs(Pi)))
        
    alpha = linspace(0,360, 36)
    
    
    listN = []
    listM1 = []
    listM2 = []
    for alphai in alpha:
        MC = alpaca.MomentCurvature(recorderFileName,FiberSection, float(Pi), alphai, 2.0, 1000) #mu*FiberSection.Ky
        script = MC.write_tcl()
    
        FolderPath = rs.DocumentPath()
        os.chdir(FolderPath)
        
        recorderFileName1 = recorderFileName + "Force" + ".out"
        recorderFileName2 = recorderFileName + "Disp" + ".out"
    
        runFileName = os.path.join(FolderPath,outputFileName)
        filepath1 = os.path.join(FolderPath,recorderFileName1)
        #filepath2 = os.path.join(FolderPath,recorderFileName2)
        time_start = time.clock()
    
        with open(outputFileName, 'w') as f:
            for line in MC.write_tcl():
                f.write(line)
            f.close()
    
        time_elapsed = (time.clock() - time_start)
        #print("Writing Time {}".format(time_elapsed))
        
        time_start = time.clock()
        
        executable = os.path.join(ghcompfolder,'Alpaca4d\OpenSees-Solvers\opensees.bat')
        #executable = os.path.join(ghcompfolder,'C:\OpenSees\bin\opensees.bat')
        
        #process = subprocess.Popen([r'C:\OpenSees\bin\OpenSees', outputFileName], shell = True, stdout=subprocess.PIPE, stderr=subprocess.PIPE)
        process = subprocess.Popen([executable, outputFileName], shell = True,  stdout=subprocess.PIPE, stderr=subprocess.PIPE)
        stdout, stderr = process.communicate()
        #print(stdout, stderr)
        process.kill()
        os.remove(runFileName)
        time_elapsed = (time.clock() - time_start)
        #print("Analyses Time {}".format(time_elapsed))
        #filepath = os.path.join(r'C:\OpenSees\bin',recorderFileName)
        fileObj = open(filepath1, 'r')
        words = fileObj.read().splitlines(" ")
        #print(fileObj.read())
        N = "None"
        if len(words) != 0:
            N = float(words[-1].split()[0])
            M1 = float(words[-1].split()[1])
            M2 = float(words[-1].split()[2])
            
            listN.append(N)
            listM1.append(M1)
            listM2.append(M2)
        fileObj.close()

        os.remove(filepath1)
    """
    fileObj = open(filepath2, 'r')
    words = fileObj.read().splitlines(" ")
    #print(fileObj.read())

    k1 = [ float(i.split()[1]) for i in words]
    k2 = [ float(i.split()[2]) for i in words]
    k3 = [ float(i.split()[3]) for i in words]
    fileObj.close()
    """
        #os.remove(filepath2)
    if N != "None" :
        return [listN, listM1, listM2]

        
if checkData:
    FiberSection.secTag = 1
    for i, item in enumerate(FiberSection.path):
        item.material.matTag = 2*(i+1)
        item.material.matTagMinMax = 2*i+1
        #print(item.material.matTag )
    j = i+2
    for i, item in enumerate(FiberSection.layer):
        j = j + i 
        item.material.matTag = 2*(j+1)
        item.material.matTagMinMax = 2*j+1
        #print(j+i)
    w = j+2
    for i, item in enumerate(FiberSection.fiber):
        w = w + i 
        item.material.matTag = 2*(w+1)
        item.material.matTagMinMax = 2*w+1
        
    #A = ghp.run(RunNEps,[-1.0, 1.0], True)
    
    
    
        
    print(FiberSection.NultNeg+0.1*FiberSection.NultNeg,FiberSection.NultPos)
    
    
    #n1 = int(mt.fabs(min(A)/stepValorPositive))
    #n2 = int(mt.fabs(max(A)/stepValorNegative))
    
    #listP = linspace(min(A), -5.0, n1) + linspace(5, max(A)-10.0, n2)
    
    
        
    listP = linspace(FiberSection.NultNeg,FiberSection.NultPos, nPoint)
    
    
    B = ghp.run(RunMCpositive, listP,False)
    B =filter(None, B)
    #C = ghp.run(RunMCnegative, listP,False)
    
    #print(B[1])
    #RunM1Cpositive(Pi): 
    
    N, M1, M2 = [], [], []
    
    for item in B:
        #item =filter(None, item) #elimino il None
        N.append(item[0])
        M1.append(item[1])
        M2.append(item[2])
    
    
    N, M1, M2 = th.list_to_tree(N), th.list_to_tree(M1), th.list_to_tree(M2)
    
    
    
    """
    for item in B:
        Nupos.append(item[0])
        M1uP.append( item[1])
        M2uP.append( item[2])
        #M3uP.append( item[3])
        
    for item in C:
        Nuneg.append(item[0])
        M1uN.append( item[1])
        M2uN.append( item[2])
    
    M1 = M1uN + M1uP[::-1] + M1uN[0:1]
    M2 = M2uN + M2uP[::-1] + M2uN[0:1]
    N = Nuneg + Nupos[::-1] + Nuneg[0:1]
    
    if direction == 1:
        M = M2
    else:
        M = M1
    """
# ---------- end _3dd_2 ----------
panel_28 = Panel("200000")
panel_29 = Panel("255")
uems01_3 = UniaxialElasticMaterialSteel01Alpaca4d(fy=multiplication_13, E0=multiplication_14, b="0.0")  # -> out, uniAxialMaterial
# ---------- uems01_3: Python ----------
"""
Create a uniaxial Elastic Material Concreate01
-
    Args:
        fc:
        fcu:
        ec0:
        ecu:
    Returns:
        uniAxialMaterial:
"""

ghenv.Component.Name = "uniaxial Elastic Material Steel01 (Alpaca4d)"
ghenv.Component.NickName = 'UEMS01'
ghenv.Component.Message = "uniaxial Steel01 (Alpaca4d)"

import sys
import Rhino.Geometry as rg
import Grasshopper as gh
import copy


## add alpaca install directory to system path

ghcompfolder = gh.Folders.DefaultAssemblyFolder
if ghcompfolder not in sys.path:
    sys.path.append(ghcompfolder)


   
   
try:
    from Alpaca4d import alpaca4d as alpaca
except:
    msg = "Cannot import Alpaca4d. Is the Alpaca4d folder available in " + ghcompfolder + "?"
    ghenv.Component.AddRuntimeMessage(gh.Kernel.GH_RuntimeMessageLevel.Error, msg)

print(a1!=None, a2, a3, a4)

checkData = True

if not fy:
    checkData = False
    msg = "Input parameter fy failed to collect data"
    ghenv.Component.AddRuntimeMessage(gh.Kernel.GH_RuntimeMessageLevel.Warning, msg)

if not E0:
    checkData = False
    msg = "Input parameter E0 failed to collect data"
    ghenv.Component.AddRuntimeMessage(gh.Kernel.GH_RuntimeMessageLevel.Warning, msg)

"""
if not b:
    checkData = False
    msg = "Input parameter b failed to collect data"
    ghenv.Component.AddRuntimeMessage(gh.Kernel.GH_RuntimeMessageLevel.Warning, msg)
"""

class uniAxialMaterialSteel01(object):
    def __init__(self, matName, fy, E0, b, a1, a2, a3, a4):
        '''Generate a uniaxial Elastic Material Steel01
            link for information: https://opensees.berkeley.edu/wiki/index.php/Steel01_Material
            Inputs:
                matName: Name of the material.
                fy: yield strength [MPa].
                E0: initial elastic tangent[MPa].
                b: strain-hardening ratio (ratio between post-yield tangent and initial elastic tangent).
                a1: isotropic hardening parameter, increase of compression yield envelope as proportion of yield strength after a plastic strain of $a2*($Fy/E0). (optional).
                a2: isotropic hardening parameter (see explanation under $a1). (optional).
                a3: isotropic hardening parameter, increase of tension yield envelope as proportion of yield strength after a plastic strain of $a4*($Fy/E0). (optional)
                a4: isotropic hardening parameter (see explanation under $a3). (optional)'''

        self.matName = matName
        self.fy = fy
        self.E0 = E0
        self.b = b
        self.a1 = a1
        self.a2 = a2
        self.a3 = a3
        self.a4 = a4
        self.tensionLimitPositive = self.fy
        self.tensionLimitNegative = -self.fy
        
        self.matTag = None
        self.matTagMinMax = None
        
        self.materialDimension = "uniAxialMaterial"
        self.materialType = "Steel01"
        
        self.esh = self.fy/self.E0
        self.eult = 6.75/100

    def ToString(self):
        return self.write_tcl()

    def write_tcl(self):
        if a1 != None and a2 == None and a3 == None and a4 == None:
            return "uniaxialMaterial Steel01 {} {} {} {} {}\n".format(self.matTag, self.fy, self.E0, self.b, self.a1)
        elif a1 != None and a2 != None and a3 == None and a4 == None:
            return "uniaxialMaterial Steel01 {} {} {} {} {} {}\n".format(self.matTag, self.fy, self.E0, self.b, self.a1, self.a2) 
        elif a1 != None and a2 != None and a3 != None and a4 == None:
            return "uniaxialMaterial Steel01 {} {} {} {} {} {} {}\n".format(self.matTag, self.fy, self.E0, self.b, self.a1, self.a2, self.a3) 
        elif a1 != None and a2 != None and a3 != None and a4 != None:
            return "uniaxialMaterial Steel01 {} {} {} {} {} {} {} {}\n".format(self.matTag, self.fy, self.E0, self.b, self.a1, self.a2, self.a3,  self.a4) 
        else:
            a = "uniaxialMaterial Steel01 {} {} {} {}\n".format(self.matTag, self.fy, self.E0, self.b)
            b = "uniaxialMaterial MinMax {} {} -min {} -max {}\n".format(self.matTagMinMax, self.matTag, self.tensionLimitNegative, self.tensionLimitPositive)
            return a + b
    def write_py(self):
        if a1 != None and a2 == None and a3 == None and a4 == None:
            return "ops.uniaxialMaterial('Steel01', {}, {}, {}, {}, {})\n".format(self.matTag, self.fy, self.E0, self.b, self.a1)
        elif a1 != None and a2 != None and a3 == None and a4 == None:
            return "ops.uniaxialMaterial('Steel01', {}, {}, {}, {}, {}, {})\n".format(self.matTag, self.fy, self.E0, self.b, self.a1, self.a2) 
        elif a1 != None and a2 != None and a3 != None and a4 == None:
            return "ops.uniaxialMaterial('Steel01', {}, {}, {}, {}, {}, {}, {})\n".format(self.matTag, self.fy, self.E0, self.b, self.a1, self.a2, self.a3) 
        elif a1 != None and a2 != None and a3 != None and a4 != None:
            return "ops.uniaxialMaterial('Steel01', {}, {}, {}, {}, {}, {}, {}, {})\n".format(self.matTag, self.fy, self.E0, self.b, self.a1, self.a2, self.a3,  self.a4) 
        else:
            return "ops.uniaxialMaterial('Steel01', {}, {}, {}, {})\n".format(self.matTag, self.fy, self.E0, self.b)



if checkData:
    uniAxialMaterial = uniAxialMaterialSteel01(name, fy, E0, b, a1, a2, a3, a4)


"""
class uniAxialMaterialSteel01(object):
    def __init__(self, matName, fy, E0, b, a1, a2, a3, a4):
        '''Generate a uniaxial Elastic Material Steel01
            link for information: https://opensees.berkeley.edu/wiki/index.php/Steel01_Material
            Inputs:
                matName: Name of the material.
                fy: yield strength [MPa].
                E0: initial elastic tangent[MPa].
                b: strain-hardening ratio (ratio between post-yield tangent and initial elastic tangent).
                a1: isotropic hardening parameter, increase of compression yield envelope as proportion of yield strength after a plastic strain of $a2*($Fy/E0). (optional).
                a2: isotropic hardening parameter (see explanation under $a1). (optional).
                a3: isotropic hardening parameter, increase of tension yield envelope as proportion of yield strength after a plastic strain of $a4*($Fy/E0). (optional)
                a4: isotropic hardening parameter (see explanation under $a3). (optional)'''

        self.matName = matName
        self.fy = fy
        self.E0 = E0
        self.b = b
        self.a1 = a1
        self.a2 = a2
        self.a3 = a3
        self.a4 = a4

        self.matTag = None

        self.materialDimension = "uniAxialMaterial"
        self.materialType = "Steel01"

    def ToString(self):
        return self.write_tcl()

    def write_tcl(self):
        if a1 != None and a2 == None and a3 == None and a4 == None:
            return "uniaxialMaterial Steel01 {} {} {} {} {}\n".format(self.matTag, self.fy, self.E0, self.b, self.a1)
        elif a1 != None and a2 != None and a3 == None and a4 == None:
            return "uniaxialMaterial Steel01 {} {} {} {} {} {}\n".format(self.matTag, self.fy, self.E0, self.b, self.a1, self.a2) 
        elif a1 != None and a2 != None and a3 != None and a4 == None:
            return "uniaxialMaterial Steel01 {} {} {} {} {} {} {}\n".format(self.matTag, self.fy, self.E0, self.b, self.a1, self.a2, self.a3) 
        elif a1 != None and a2 != None and a3 != None and a4 != None:
            return "uniaxialMaterial Steel01 {} {} {} {} {} {} {} {}\n".format(self.matTag, self.fy, self.E0, self.b, self.a1, self.a2, self.a3,  self.a4) 
        else:
            return "uniaxialMaterial Steel01 {} {} {} {}\n".format(self.matTag, self.fy, self.E0, self.b)
    def write_py(self):
        if a1 != None and a2 == None and a3 == None and a4 == None:
            return "ops.uniaxialMaterial('Steel01', {}, {}, {}, {}, {})\n".format(self.matTag, self.fy, self.E0, self.b, self.a1)
        elif a1 != None and a2 != None and a3 == None and a4 == None:
            return "ops.uniaxialMaterial('Steel01', {}, {}, {}, {}, {}, {})\n".format(self.matTag, self.fy, self.E0, self.b, self.a1, self.a2) 
        elif a1 != None and a2 != None and a3 != None and a4 == None:
            return "ops.uniaxialMaterial('Steel01', {}, {}, {}, {}, {}, {}, {})\n".format(self.matTag, self.fy, self.E0, self.b, self.a1, self.a2, self.a3) 
        elif a1 != None and a2 != None and a3 != None and a4 != None:
            return "ops.uniaxialMaterial('Steel01', {}, {}, {}, {}, {}, {}, {}, {})\n".format(self.matTag, self.fy, self.E0, self.b, self.a1, self.a2, self.a3,  self.a4) 
        else:
            return "ops.uniaxialMaterial('Steel01', {}, {}, {}, {})\n".format(self.matTag, self.fy, self.E0, self.b)
"""
# ---------- end uems01_3 ----------
panel_30 = Panel(uems01_3.uniAxialMaterial)

f_2 = FiberAlpaca4d(material=uems01_3.uniAxialMaterial, point=pt, area="0.000314")  # -> out, fiber; inputs point: Point3d; same code as f

panel_31 = Panel(mnm_3.N)
bnd_3 = Bounds(Numbers=mnm_2.M1)
panel_32 = Panel(mnm_2.M1)
dedomain_3 = DeconstructDomain(Domain=bnd_3)  # -> Start, End
panel_33 = Panel(mnm_3.M)
multiplication_16 = Multiplication(A=mnm_3.N, B=Slider(0.004, range=0..0.01))
multiplication_17 = Multiplication(A=mnm_3.M, B=Slider(0.1, range=0.001..5))
gradient_2 = Gradient(
    LowerLimit=dedomain_3.Start,
    UpperLimit=dedomain_3.End,
    Parameter=mnm_2.M1,
    stops=[0: RGB(234, 38, 0), 0.25: RGB(234, 126, 0), 0.5: RGB(254, 244, 84), 0.75: RGB(173, 203, 249), 1: RGB(75, 107, 169)])
demesh_2 = DeconstructMesh(Mesh=P_4.pathSurf)  # -> Vertices, graft(Faces), Colours, Normals
pt_4 = ConstructPoint(XCoordinate=multiplication_16, YCoordinate=multiplication_17, ZCoordinate=0)
intcrv_3 = Interpolate(Vertices=pt_4, Degree=3, Periodic=False, KnotStyle=1)  # -> Curve, Length, Domain
multiplication_18 = Multiplication(A=demesh_2.Normals, B=mnm_2.M1)
panel_34 = Panel(l.layer)
conmesh = ConstructMesh(Vertices=demesh_2.Vertices, Faces=demesh_2.Faces, Colours=graft(gradient_2))
area_5 = Area(Geometry=flatten(l.layerCircle))  # -> Area, Centroid
multiplication_19 = Multiplication(A=multiplication_18, B=Slider(100, range=0..100))
ma = MassAddition(Input=area_5.Area)  # -> Result, PartialResults

P_5 = PathAlpaca4d(material=uemc01.uniAxialMaterial, polyC=cluster_2, U=Slider(10, range=0..20), V=Slider(10, range=0..100))  # -> out, path, pathSurf; inputs polyC: Curve, U: Int32, V: Int32; same code as P

vdisex = VectorDisplayEx(Point=facen_2.Centers, Vector=multiplication_19, Colour=gradient_2, Width="4")
mcm = MomentCurvatureModelAlpaca4d(FiberSection=python_2.FiberSection, P=neg_7, alpha=number_slider_28, maxPhi=number_slider_26, nIncr=number_slider_27)  # -> out, script, k1, k2, M1, M2; inputs nIncr: Int32
# ---------- mcm: Python ----------
"""
Run an OpenSees Analysis
-
    Args:
        FiberSection:
        P: axial load 
        alpha: ------
        maxPhi: Max Curvature
        nIncr: Number of analysis increments
    Returns:
        AlpacaSolvedModel:
"""



import Rhino.RhinoDoc
import Grasshopper as gh
import copy
import rhinoscriptsyntax as rs
import Rhino.Geometry as rg
import os
import time
import sys
import subprocess
import math as mt



ghenv.Component.Name = "Moment Curvature Model (Alpaca4d)"
ghenv.Component.NickName = 'MCM'
ghenv.Component.Message = "Moment Curvature Model (Alpaca4d)"

ghcompfolder = gh.Folders.DefaultAssemblyFolder
if ghcompfolder not in sys.path:
    sys.path.append(ghcompfolder)

try:
    from Alpaca4d import alpaca4d as alpaca
except:
    msg = "Cannot import Alpaca4d. Is the Alpaca4d folder available in " + ghcompfolder + "?"
    ghenv.Component.AddRuntimeMessage(gh.Kernel.GH_RuntimeMessageLevel.Error, msg)


checkData = True



if not FiberSection:
    checkData = False
    msg = "Input parameter AlpacaModel failed to collect data"
    ghenv.Component.AddRuntimeMessage(gh.Kernel.GH_RuntimeMessageLevel.Warning, msg)
if not P: #
    checkData = False
    msg = "Input parameter P failed to collect data"
    ghenv.Component.AddRuntimeMessage(gh.Kernel.GH_RuntimeMessageLevel.Warning, msg)
    
if not alpha: #
    checkData = False
    msg = "Input parameter alpha failed to collect data"
    ghenv.Component.AddRuntimeMessage(gh.Kernel.GH_RuntimeMessageLevel.Warning, msg)

if not maxPhi: #
    checkData = False
    msg = "Input parameter maxPhi failed to collect data"
    ghenv.Component.AddRuntimeMessage(gh.Kernel.GH_RuntimeMessageLevel.Warning, msg)

if not nIncr: #
    checkData = False
    msg = "Input parameter nIncr failed to collect data"
    ghenv.Component.AddRuntimeMessage(gh.Kernel.GH_RuntimeMessageLevel.Warning, msg)
    


################### ASSEMBLE MODEL ##############################
if checkData:
    FiberSection.secTag = 1
    for i, item in enumerate(FiberSection.path):
        item.material.matTag = 2*(i+1)
        item.material.matTagMinMax = 2*i+1
        #print(item.material.matTag )
    j = i+2
    for i, item in enumerate(FiberSection.layer):
        j = j + i 
        item.material.matTag = 2*(j+1)
        item.material.matTagMinMax = 2*j+1
        #print(j+i)
    w = j+2
    for i, item in enumerate(FiberSection.fiber):
        w = w + i 
        item.material.matTag = 2*(w+1)
        item.material.matTagMinMax = 2*w+1
#################################################################
    MC = alpaca.MomentCurvature('MKsection',FiberSection, P, alpha, maxPhi, nIncr)

script = MC.write_tcl()
#print(script)

outputFileName = 'openSeesSectionModel'
recorderFileName1 = 'MKsectionForce.out'
recorderFileName2 = 'MKsectionDisp.out'

if checkData:
    FolderPath = rs.DocumentPath()
    os.chdir(FolderPath)

    
for dirpath, dirnames, filenames in os.walk(FolderPath):
    for filename in filenames:
        if filename == outputFileName:
            file = os.path.join(dirpath,outputFileName)
            filepath1 = os.path.join(dirpath,recorderFileName1)
            filepath2 = os.path.join(dirpath,recorderFileName2)
        elif filename == recorderFileName1:
            file1 = os.path.join(dirpath,recorderFileName1)
            file2 = os.path.join(dirpath,recorderFileName2)
            os.remove(file1)
            os.remove(file2)

time_start = time.clock()

with open(outputFileName, 'w') as f:
    for line in MC.write_tcl():
        f.write(line)
    f.close()

time_elapsed = (time.clock() - time_start)
#print("Writing Time {}".format(time_elapsed))

time_start = time.clock()

executable = os.path.join(ghcompfolder,'Alpaca4d\OpenSees-Solvers\opensees.bat')

#process = subprocess.Popen([r'C:\OpenSees\bin\OpenSees', outputFileName], shell = True, stdout=subprocess.PIPE, stderr=subprocess.PIPE)
process = subprocess.Popen([executable, outputFileName], shell = True,  stdout=subprocess.PIPE, stderr=subprocess.PIPE)
stdout, stderr = process.communicate()
print(stderr)
process.kill()

time_elapsed = (time.clock() - time_start)
print("Analyses Time: {} s".format(time_elapsed))




fileObj = open(filepath1, 'r')
words = fileObj.read().splitlines(" ")
#N = [ float(i.split()[0]) for i in words]
M1 = [ float(i.split()[1]) for i in words]
M2 = [ float(i.split()[2]) for i in words]
#M3 = [ float(i.split()[3]) for i in words]
fileObj.close()
#FiberSection = [k, M]

fileObj = open(filepath2, 'r')
words = fileObj.read().splitlines(" ")
#N = [ float(i.split()[0]) for i in words]
k1 = [ float(i.split()[1]) for i in words]
k2 = [ float(i.split()[2]) for i in words]
#k3 = [ float(i.split()[3]) for i in words]
fileObj.close()
# ---------- end mcm ----------

panel_35 = Panel("diagram N-M")  # disabled
panel_36 = Panel("Bending Moment |KNm|")  # disabled
panel_37 = Panel("Axial load |KN|")  # disabled
panel_38 = Panel("diagram N-M")  # disabled
gh_cpython_3 = GH_CPython(data_X=mnm_3.N, data_Y=mnm_3.M, name_AxisX=panel_37, name_AxisY=panel_36, title=panel_38, NameSave=panel_35)  # -> output, pathSave; inputs data_X: list, data_Y: list, name_AxisX: list, name_AxisY: list, title: list, NameSave: list; disabled
# ---------- gh_cpython_3: Python ----------
# -*- coding: utf-8 -*-
""" 
Python Script
Created on  Saturday August 2021 05:11:41 
@author:  Domen 

[desc]
Description of the plugin Here
Write here any thing... 
[/desc]

ARGUMENTS:
----------
<inp> 
    _input :[required] - [type = int] - [default = None] 
    Descripe your input here 
        * bullet point.
        * bullet point
</inp>
<inp>
    Other inputs go here ...
</inp>

RETURN:
----------
    <out>
        output_ : indicate your output description here. \n refers to a new line.
    </out>

"""
import matplotlib.pyplot as plt
import numpy as np
import os

print('getcwd:      ', os.getcwd())
print('__file__:    ', __file__)

pathSave = os.path.join(os.getcwd(), "NameSave"+ ".png")
 
# Data for plotting
t = data_X
s = data_Y


fig, ax = plt.subplots()
ax.plot(t, s, '.-')

ax.set(xlabel=name_AxisX, ylabel=name_AxisY,
       title=title)
ax.grid()
fig.set_size_inches(3, 3)
fig.savefig(NameSave +".png")
#plt.savefig(pathSave)
# ---------- end gh_cpython_3 ----------

# ---- group: FiberSection
python_3 = GhPythonScript(path=P_4.path, layer=l_2.layer)  # -> out, FiberSection, FiberMesh, PropSection; inputs path: list, layer: list; disabled
# ---------- python_3: Python ----------
__author__ = "Domen"
__version__ = "2021.08.07"

import rhinoscriptsyntax as rs
import ghpythonlib.components as ghcomp
import Rhino.Geometry as rg
import math as mt

"""
for i, item in enumerate(path):
    print(i, item)
    item.material.matTag = i + 1
"""

class FiberSection(object):
    def __init__(self, path, layer):

        self.path = path
        self.layer = layer
        self.secTag = None

        self.mesh = []
        for item in path:
            self.mesh.append(item.surf)
        self.mesh = ghcomp.Kangaroo2Component.CombineClean(self.mesh)
        calculateProp = rg.AreaMassProperties.Compute(self.mesh)
        self.centerSection = calculateProp.Centroid
        self.Area = calculateProp.Area
        
        NuPositive = []
        NuNegative = []
        for item in self.path:
            area = rg.AreaMassProperties.Compute(item.surf).Area
            NuPositive.append( area*item.material.tensionLimitPositive )
            NuNegative.append( area*item.material.tensionLimitNegative )
            
            
        for item in self.layer:
            area = item.Atot*item.nBar
            NuPositive.append( area*item.material.tensionLimitPositive )
            NuNegative.append( area*item.material.tensionLimitNegative )
            
        self.NultNeg = sum(NuNegative)
        self.NultPos = sum(NuPositive)
        # calcolo proprietà della sezione #
        area = 'Area: ' + str(self.Area)  + '\n'
        centroidC = 'Centroid coordinates: ' + "x: {}, y: {}, z: {} ".format(self.centerSection.X, self.centerSection.Y, self.centerSection.Z) + '\n'
        Inertia = calculateProp.CentroidCoordinatesMomentsOfInertia
        InertiaStr = 'Inertia respect the centroid : ' + "Ixx: {}, Iyy: {}, Izz: {} ".format(Inertia.X, Inertia.Y, Inertia.Z) + '\n'
        Nultimo = 'Axial Force ultimate: ' + str([self.NultNeg, self.NultPos])  + '\n'
        self.prop = ''.join([area, centroidC, InertiaStr, Nultimo ])
        

    def ToString(self):
        return self.write_tcl()

    def write_tcl(self):
        section = "section Fiber {} -GJ 10000 {}\n".format(self.secTag, "{;") # -GJ 10000
        # PATH
        pathList = ''.join([ i.ToString() for i in path ])
        # LAYER
        layerList = ''.join([ i.ToString() for i in layer ])
        
        return section + pathList + layerList +"}\n"

    def write_py(self):
        py_text = "ops.section('Elastic',{},{},{},{},{},{},{},{},{})\n".format(self.sectionTag, self.material.E, self.Area, self.Izz, self.Iyy, self.material.G, self.J, self.alphaY, self.alphaZ)
        return py_text


FiberSection = FiberSection(path, layer)
FiberMesh = FiberSection.mesh
PropSection = FiberSection.prop
# ---------- end python_3 ----------

# ----
panel_39 = Panel(mcm.script)
mcol_3 = MeshColours(Mesh=python_3.FiberMesh, Colours=ColourSwatch(SwatchColor=RGBA(249, 255, 84, 120)))
srf_3 = Surface([l.layerCircle, l_2.layerCircle])
panel_40 = Panel(mcm.out)

panel_41 = Panel("Axial load |KN|")  # disabled
panel_42 = Panel("Bending Moment |KNm|")  # disabled
panel_43 = Panel("diagram N-M")  # disabled
panel_44 = Panel("diagram N-M IPE")  # disabled
gh_cpython_4 = GH_CPython(data_X=dm1m2_2.M1, data_Y=dm1m2_2.M2, name_AxisX=panel_41, name_AxisY=panel_42, title=panel_43, NameSave=panel_44)  # -> output, pathSave; inputs data_X: list, data_Y: list, name_AxisX: list, name_AxisY: list, title: list, NameSave: list; disabled
# ---------- gh_cpython_4: Python ----------
# -*- coding: utf-8 -*-
""" 
Python Script
Created on  Saturday August 2021 05:11:41 
@author:  Domen 

[desc]
Description of the plugin Here
Write here any thing... 
[/desc]

ARGUMENTS:
----------
<inp> 
    _input :[required] - [type = int] - [default = None] 
    Descripe your input here 
        * bullet point.
        * bullet point
</inp>
<inp>
    Other inputs go here ...
</inp>

RETURN:
----------
    <out>
        output_ : indicate your output description here. \n refers to a new line.
    </out>

"""
import matplotlib.pyplot as plt
import numpy as np
import os

print('getcwd:      ', os.getcwd())
print('__file__:    ', __file__)

pathSave = os.path.join(os.getcwd(), "NameSave"+ ".png")
 
# Data for plotting
t = data_X
s = data_Y


fig, ax = plt.subplots()
ax.plot(t, s, '.-')

ax.set(xlabel=name_AxisX, ylabel=name_AxisY,
       title=title)
ax.grid()
fig.set_size_inches(3, 3)
fig.savefig(title +".png")
#plt.savefig(pathSave)
# ---------- end gh_cpython_4 ----------

panel_45 = Panel(python_3.PropSection)
panel_46 = Panel(python_3.FiberSection)

# ---- group: 3D
mcm_2 = MomentCurvatureModelAlpaca4d(FiberSection=python_2.FiberSection, P=neg_7, alpha=number_slider_28, maxPhi=number_slider_26, nIncr=number_slider_27)  # -> out, script, k1, k2, M1, M2; inputs nIncr: Int32
# ---------- mcm_2: Python ----------
"""
Run an OpenSees Analysis
-
    Args:
        FiberSection:
        P: axial load 
        mu: Target ductility for analysis
        nIncr: Number of analysis increments
    Returns:
        AlpacaSolvedModel:
"""



import Rhino.RhinoDoc
import Grasshopper as gh
import copy
import rhinoscriptsyntax as rs
import Rhino.Geometry as rg
import os
import time
import sys
import subprocess
import math as mt



ghenv.Component.Name = "Moment Curvature Model (Alpaca4d)"
ghenv.Component.NickName = 'MCM'
ghenv.Component.Message = "Moment Curvature Model (Alpaca4d)"

ghcompfolder = gh.Folders.DefaultAssemblyFolder
if ghcompfolder not in sys.path:
    sys.path.append(ghcompfolder)

try:
    from Alpaca4d import alpaca4d as alpaca
except:
    msg = "Cannot import Alpaca4d. Is the Alpaca4d folder available in " + ghcompfolder + "?"
    ghenv.Component.AddRuntimeMessage(gh.Kernel.GH_RuntimeMessageLevel.Error, msg)


checkData = True



if not FiberSection:
    checkData = False
    msg = "Input parameter AlpacaModel failed to collect data"
    ghenv.Component.AddRuntimeMessage(gh.Kernel.GH_RuntimeMessageLevel.Warning, msg)
if not P: #
    checkData = False
    msg = "Input parameter P failed to collect data"
    ghenv.Component.AddRuntimeMessage(gh.Kernel.GH_RuntimeMessageLevel.Warning, msg)
    
if not alpha: #
    checkData = False
    msg = "Input parameter alpha failed to collect data"
    ghenv.Component.AddRuntimeMessage(gh.Kernel.GH_RuntimeMessageLevel.Warning, msg)

if not maxPhi: #
    checkData = False
    msg = "Input parameter maxPhi failed to collect data"
    ghenv.Component.AddRuntimeMessage(gh.Kernel.GH_RuntimeMessageLevel.Warning, msg)

if not nIncr: #
    checkData = False
    msg = "Input parameter nIncr failed to collect data"
    ghenv.Component.AddRuntimeMessage(gh.Kernel.GH_RuntimeMessageLevel.Warning, msg)
    
class MomentCurvature(object):
    def __init__(self, section, axialLoad, alpha, maxPhi, numIncr=100):
        #^ y
        #|
        #|
        #|------> x
        self.section = section
        self.axialLoad = axialLoad
        self.alpha = mt.radians(alpha)
        self.maxPhi = maxPhi
        self.numIncr= numIncr
        # Compute curvature increment
        #self.dK = self.maxK / self.numIncr
        self.secTag = 1
        

    def ToString(self):
        return self.write_tcl()

    def write_tcl(self):
        # Define two nodes at (0,0)
        clean = "wipe\n"
        model = "model BasicBuilder -ndm 3 -ndf 6\n"
        
        materialFiber = ''.join([ i.material.write_tcl() for i in self.section.fiber ])
        materialPath = ''.join([ i.material.write_tcl() for i in self.section.path ])
        materialLayer = ''.join([ i.material.write_tcl() for i in self.section.layer ])
        material = materialFiber + materialPath + materialLayer
        
        section = self.section.ToString()
        node1 = "node {} {} {} {}\n".format(1, self.section.centerSection.X, self.section.centerSection.Y, self.section.centerSection.Z)
        node2 = "node {} {} {} {}\n".format(2, self.section.centerSection.X, self.section.centerSection.Y, self.section.centerSection.Z)
        # Fix all degrees of freedom except axial and bending
        fix1 = "fix {} {} {} {} {} {} {}\n".format(1, 1, 1, 1, 1 ,1, 1) #node tag Fx Fy Fz Mx My Mz
        fix2 = "fix {} {} {} {} {} {} {}\n".format(2, 0, 1, 1, 1, 0, 0) #node tag Fx Fy Fz Mx My Mz
        # Define element
        ele = "element zeroLengthSection {} {} {} {} -orient 1 0 0 0 {} {}\n".format( 1, 1, 2, self.secTag, mt.cos(self.alpha), mt.sin(self.alpha)) #-orient 1 0 0 0 $cos $sin
        # Define constant axial load
        pattern = 'pattern Plain {} "{}" {}\n'.format( 1, 'Constant', "{;")   
        load = "load {} {} {} {} {} {} {};\n".format(2, self.axialLoad, 0.0, 0.0, 0.0, 0.0, 0.0) +  "}\n" 
        # analysis for constant axial load
        Integrator = "integrator LoadControl {}\n".format( 0.1)
        System = "system BandGeneral\n" #-piv
        Test = "test NormUnbalance {} {}\n".format( 1e-10, 1000)
        number = "numberer RCM\n"
        constraints = "constraints Plain\n"
        algorithm = "algorithm Newton\n"
        analysis = "analysis Static\n"
        # Do one analysis for constant axial load
        analyze = "analyze {}\n".format(10) 
        lC = "loadConst -time 0.0\n"
        # Define reference moment 
        recorder1 = "recorder Element -file MKsectionForce.out -ele 1 section force\n"
        recorder2 = "recorder Element -file MKsectionDef.out -ele 1 section deformation\n"
        patternM = 'pattern Plain {} "{}" {}\n'.format( 2, 'Linear', "{;")   
        # Use displacement control at node 2 for section analysis
        
        #IntegratorD = "integrator DisplacementControl {} {} {} {} {} {}\n".format(2,3,0.00035,1,self.dK,self.dK)
        """
        if self.direction == 1 and self.maxPhi >0:
            directionID = 5
            loadM = "load {} {} {} {} {} {} {};\n".format(2, 0.0, 0.0, 0.0, 0.0, self.direction, 0.0) +  "}\n"
            
        elif self.direction == 2 and self.maxPhi >0:
            directionID = 6
            loadM = "load {} {} {} {} {} {} {};\n".format(2, 0.0, 0.0, 0.0, 0.0, 0.0, self.direction) +  "}\n" 
            
        elif self.direction == 1 and self.maxPhi <0:
            directionID = 5
            loadM = "load {} {} {} {} {} {} {};\n".format(2, 0.0, 0.0, 0.0, 0.0, -self.direction, 0.0) +  "}\n" 
            
        elif self.direction == 2 and self.maxPhi <0:
            directionID = 6
            loadM = "load {} {} {} {} {} {} {};\n".format(2, 0.0, 0.0, 0.0, 0.0, 0.0, -self.direction) +  "}\n" 
        """
        loadM = "load {} {} {} {} {} {} {};\n".format(2, 0.0, 0.0, 0.0, 0.0, 1.0, 0.0) +  "}\n" 
        IntegratorD = "integrator DisplacementControl {} {} {}\n".format(2, 5, self.maxPhi/self.numIncr)
        #IntegratorD = 'integrator ' + self.Integrator.ToString() + "\n"
        analyze2 = "analyze {}\n".format(self.numIncr) + "\n" + "wipe"+ "\n"

        return clean + model + material + section +  node1 + node2 + fix1 + fix2 + ele + pattern + load + Integrator + System + Test + number + constraints + algorithm + analysis + analyze +lC + recorder1+ recorder2 + patternM + loadM + IntegratorD + analyze2


    def write_py(self):
        # Define two nodes at (0,0)


        return node1 + node2 + fix1 + fix2 + ele  + timeSeries + pattern + load + Integrator + System + test + number + constraints + algorithm + analysis + analyze + timeSeriesM + patternM + loadM + IntegratorD + analyze2

if checkData:
    FiberSection.secTag = 1
    for i, item in enumerate(FiberSection.path):
        item.material.matTag = 2*(i+1)
        item.material.matTagMinMax = 2*i+1
        #print(item.material.matTag )
    j = i+2
    for i, item in enumerate(FiberSection.layer):
        j = j + i 
        item.material.matTag = 2*(j+1)
        item.material.matTagMinMax = 2*j+1
        #print(j+i)
    w = j+2
    for i, item in enumerate(FiberSection.fiber):
        w = w + i 
        item.material.matTag = 2*(w+1)
        item.material.matTagMinMax = 2*w+1
        
    MC = MomentCurvature(FiberSection, P, alpha, maxPhi, nIncr)

script = MC.write_tcl()
#print(script)

outputFileName = 'openSeesSectionModel'
recorderFileName1 = 'MKsectionForce.out'
recorderFileName2 = 'MKsectionDef.out'

if checkData:
    FolderPath = rs.DocumentPath()
    os.chdir(FolderPath)

    
for dirpath, dirnames, filenames in os.walk(FolderPath):
    for filename in filenames:
        if filename == outputFileName:
            file = os.path.join(dirpath,outputFileName)
            filepath1 = os.path.join(dirpath,recorderFileName1)
            filepath2 = os.path.join(dirpath,recorderFileName2)
        elif filename == recorderFileName1:
            file1 = os.path.join(dirpath,recorderFileName1)
            file2 = os.path.join(dirpath,recorderFileName2)
            os.remove(file1)
            os.remove(file2)

time_start = time.clock()

with open(outputFileName, 'w') as f:
    for line in MC.write_tcl():
        f.write(line)
    f.close()

time_elapsed = (time.clock() - time_start)
#print("Writing Time {}".format(time_elapsed))


time_start = time.clock()

executable = os.path.join(ghcompfolder,'Alpaca4d\OpenSees-Solvers\opensees.bat')

#process = subprocess.Popen([r'C:\OpenSees\bin\OpenSees', outputFileName], shell = True, stdout=subprocess.PIPE, stderr=subprocess.PIPE)
process = subprocess.Popen([executable, outputFileName], shell = True,  stdout=subprocess.PIPE, stderr=subprocess.PIPE)
stdout, stderr = process.communicate()
print(stdout, stderr)
process.kill()

time_elapsed = (time.clock() - time_start)
print("Analyses Time {}".format(time_elapsed))




fileObj = open(filepath1, 'r')
words = fileObj.read().splitlines(" ")
#N = [ float(i.split()[0]) for i in words]
M1 = [ float(i.split()[1]) for i in words]
M2 = [ float(i.split()[2]) for i in words]
#M3 = [ float(i.split()[3]) for i in words]
fileObj.close()
#FiberSection = [k, M]

fileObj = open(filepath2, 'r')
words = fileObj.read().splitlines(" ")
#N = [ float(i.split()[0]) for i in words]
k1 = [ float(i.split()[1]) for i in words]
k2 = [ float(i.split()[2]) for i in words]
#k3 = [ float(i.split()[3]) for i in words]
fileObj.close()
# ---------- end mcm_2 ----------

# ----
multiplication_20 = Multiplication(A=mcm.k2, B=Slider(10, range=1..10))
multiplication_21 = Multiplication(A=mcm.M2, B=Slider(0.0006, range=0.0001..0.001))
pt_5 = ConstructPoint(XCoordinate=multiplication_20, YCoordinate=multiplication_21, ZCoordinate=0)
pline_3 = PolyLine(Vertices=pt_5, Closed=False)
gh_cpython_5 = GH_CPython(
    data_X=mcm_2.k2,
    data_Y=mcm_2.M2,
    name_AxisX="Curvature",
    name_AxisY="Bending Moment |KNm|",
    title="diagram M-k",
    NameSave="diagram M-k")  # -> output, pathSave; inputs data_X: list, data_Y: list, name_AxisX: list, name_AxisY: list, title: list, NameSave: list
# ---------- gh_cpython_5: Python ----------
# -*- coding: utf-8 -*-
""" 
Python Script
Created on  Saturday August 2021 05:11:41 
@author:  Domen 

[desc]
Description of the plugin Here
Write here any thing... 
[/desc]

ARGUMENTS:
----------
<inp> 
    _input :[required] - [type = int] - [default = None] 
    Descripe your input here 
        * bullet point.
        * bullet point
</inp>
<inp>
    Other inputs go here ...
</inp>

RETURN:
----------
    <out>
        output_ : indicate your output description here. \n refers to a new line.
    </out>

"""
import matplotlib.pyplot as plt
import numpy as np
import os

print('getcwd:      ', os.getcwd())
print('__file__:    ', __file__)

pathSave = os.path.join(os.getcwd(), "NameSave"+ ".png")
 
# Data for plotting
t = data_X
s = data_Y


fig, ax = plt.subplots()
ax.plot(t, s)

ax.set(xlabel=name_AxisX, ylabel=name_AxisY,
       title=title)
ax.grid()

fig.savefig(title +".png")
#plt.savefig(pathSave)
# ---------- end gh_cpython_5 ----------
mcm_3 = MomentCurvatureModelAlpaca4d(
    FiberSection=python_2.FiberSection,
    P=neg_7,
    alpha=Slider(0.001, range=0..0.001),
    maxPhi=number_slider_26,
    nIncr=number_slider_27)  # -> out, script, k1, k2, M1, M2; inputs nIncr: Int32
# ---------- mcm_3: Python ----------
"""
Run an OpenSees Analysis
-
    Args:
        FiberSection:
        P: axial load 
        alpha: angle of local axis rotation  
        maxPhi: Max Curvature
        nIncr: Number of analysis increments
    Returns:
        AlpacaSolvedModel:
"""



import Rhino.RhinoDoc
import Grasshopper as gh
import copy
import rhinoscriptsyntax as rs
import Rhino.Geometry as rg
import os
import time
import sys
import subprocess
import math as mt



ghenv.Component.Name = "Moment Curvature Model (Alpaca4d)"
ghenv.Component.NickName = 'MCM'
ghenv.Component.Message = "Moment Curvature Model (Alpaca4d)"

ghcompfolder = gh.Folders.DefaultAssemblyFolder
if ghcompfolder not in sys.path:
    sys.path.append(ghcompfolder)

try:
    from Alpaca4d import alpaca4d as alpaca
except:
    msg = "Cannot import Alpaca4d. Is the Alpaca4d folder available in " + ghcompfolder + "?"
    ghenv.Component.AddRuntimeMessage(gh.Kernel.GH_RuntimeMessageLevel.Error, msg)


checkData = True



if not FiberSection:
    checkData = False
    msg = "Input parameter AlpacaModel failed to collect data"
    ghenv.Component.AddRuntimeMessage(gh.Kernel.GH_RuntimeMessageLevel.Warning, msg)
if not P: #
    checkData = False
    msg = "Input parameter P failed to collect data"
    ghenv.Component.AddRuntimeMessage(gh.Kernel.GH_RuntimeMessageLevel.Warning, msg)
    
if not alpha: #
    checkData = False
    msg = "Input parameter alpha failed to collect data"
    ghenv.Component.AddRuntimeMessage(gh.Kernel.GH_RuntimeMessageLevel.Warning, msg)

if not maxPhi: #
    checkData = False
    msg = "Input parameter maxPhi failed to collect data"
    ghenv.Component.AddRuntimeMessage(gh.Kernel.GH_RuntimeMessageLevel.Warning, msg)

if not nIncr: #
    checkData = False
    msg = "Input parameter nIncr failed to collect data"
    ghenv.Component.AddRuntimeMessage(gh.Kernel.GH_RuntimeMessageLevel.Warning, msg)
    


################### ASSEMBLE MODEL ##############################
if checkData:
    FiberSection.secTag = 1
    for i, item in enumerate(FiberSection.path):
        item.material.matTag = 2*(i+1)
        item.material.matTagMinMax = 2*i+1
        #print(item.material.matTag )
    j = i+2
    for i, item in enumerate(FiberSection.layer):
        j = j + i 
        item.material.matTag = 2*(j+1)
        item.material.matTagMinMax = 2*j+1
        #print(j+i)
    w = j+2
    for i, item in enumerate(FiberSection.fiber):
        w = w + i 
        item.material.matTag = 2*(w+1)
        item.material.matTagMinMax = 2*w+1
#################################################################
    MC = alpaca.MomentCurvature(FiberSection, P, alpha, maxPhi, nIncr)

script = MC.write_tcl()
#print(script)

outputFileName = 'openSeesSectionModel'
recorderFileName1 = 'MKsectionForce.out'
recorderFileName2 = 'MKsectionDef.out'

if checkData:
    FolderPath = rs.DocumentPath()
    os.chdir(FolderPath)

    
for dirpath, dirnames, filenames in os.walk(FolderPath):
    for filename in filenames:
        if filename == outputFileName:
            file = os.path.join(dirpath,outputFileName)
            filepath1 = os.path.join(dirpath,recorderFileName1)
            filepath2 = os.path.join(dirpath,recorderFileName2)
        elif filename == recorderFileName1:
            file1 = os.path.join(dirpath,recorderFileName1)
            file2 = os.path.join(dirpath,recorderFileName2)
            os.remove(file1)
            os.remove(file2)

time_start = time.clock()

with open(outputFileName, 'w') as f:
    for line in MC.write_tcl():
        f.write(line)
    f.close()

time_elapsed = (time.clock() - time_start)
#print("Writing Time {}".format(time_elapsed))

time_start = time.clock()

executable = os.path.join(ghcompfolder,'Alpaca4d\OpenSees-Solvers\opensees.bat')

#process = subprocess.Popen([r'C:\OpenSees\bin\OpenSees', outputFileName], shell = True, stdout=subprocess.PIPE, stderr=subprocess.PIPE)
process = subprocess.Popen([executable, outputFileName], shell = True,  stdout=subprocess.PIPE, stderr=subprocess.PIPE)
stdout, stderr = process.communicate()
print(stderr)
process.kill()

time_elapsed = (time.clock() - time_start)
print("Analyses Time: {} s".format(time_elapsed))




fileObj = open(filepath1, 'r')
words = fileObj.read().splitlines(" ")
#N = [ float(i.split()[0]) for i in words]
M1 = [ float(i.split()[1]) for i in words]
M2 = [ float(i.split()[2]) for i in words]
#M3 = [ float(i.split()[3]) for i in words]
fileObj.close()
#FiberSection = [k, M]

fileObj = open(filepath2, 'r')
words = fileObj.read().splitlines(" ")
#N = [ float(i.split()[0]) for i in words]
k1 = [ float(i.split()[1]) for i in words]
k2 = [ float(i.split()[2]) for i in words]
#k3 = [ float(i.split()[3]) for i in words]
fileObj.close()
# ---------- end mcm_3 ----------
panel_47 = Panel(mcm_3.script)
graph = QuickGraph(mcm_3.M2, SortOrder=0)

# ==== cluster Cluster
x_dimension = ClusterInput()
y_dimension = ClusterInput()
cover = ClusterInput()
x_dimension_2 = Number(x_dimension)
y_dimension_2 = Number(y_dimension)
cover_2 = Number(cover)

# ---- group: sezione rettangolare
division = Division(A=y_dimension_2, B=2)
division_2 = Division(A=x_dimension_2, B=2)
neg = Negative(Value=division)
neg_2 = Negative(Value=division_2)
neg_3 = Negative(Value=cover_2)
dom = ConstructDomain(DomainStart=neg, DomainEnd=division)
dom_2 = ConstructDomain(DomainStart=neg_2, DomainEnd=division_2)
rectangle = Rectangle(Plane=PlaneXY(0, 0, 0), XSize=dom_2, YSize=dom, Radius=0)  # -> Rectangle, Length
offset = OffsetCurve(Curve=rectangle.Rectangle, Distance=neg_3, Plane=PlaneXY(0, 0, 0), Corners=1)
explode = Explode(Curve=offset, Recursive=True)  # -> Segments, Vertices

# ----
explode_2 = Explode(Curve=rectangle.Rectangle, Recursive=True)  # -> Segments, Vertices
item = ListItem(List=explode_2.Segments, Index=0, Wrap=True)  # -> Item, Item1, Item2, Item3
end = EndPoints(Curve=item.Item)  # -> Start, End
end_2 = EndPoints(Curve=item.Item1)  # -> Start, End
polyc = Curve(rectangle.Rectangle)
line = Curve(explode.Segments)
aligndim = AlignedDimension(
    Plane=PlaneXY(0, 0, 0),
    PointA=end.Start,
    PointB=end.End,
    Offset=Slider(-0.1, range=-10..10),
    Text="{0:0.00}",
    Size="0.02")
aligndim_2 = AlignedDimension(
    Plane=PlaneXY(0, 0, 0),
    PointA=end_2.Start,
    PointB=end_2.End,
    Offset=Slider(-0.1, range=-10..10),
    Text="{0:0.00}",
    Size="0.02")
polyc_2 = ClusterOutput(polyc)
line_2 = ClusterOutput(line)

# ==== cluster Cluster_2
bsup = ClusterInput()
tsup = ClusterInput()
tw = ClusterInput()
H = ClusterInput()
bsup_2 = Number(bsup)
tsup_2 = Number(tsup)
tw_2 = Number(tw)
H_2 = Number(H)
tinf = ClusterInput()
binf = ClusterInput()
tinf_2 = Number(tinf)
binf_2 = Number(binf)
number_slider = Slider(-0.03, range=-10..10)
abs = Absolute(Value=number_slider)
multiplication = Multiplication(A=abs, B=Slider(2, range=0..10))

# ---- group: sezione rettangolare
division = Division(A=H_2, B=2)
division_2 = Division(A=tw_2, B=2)
subtraction = Subtraction(A=division, B=tinf_2)
subtraction_2 = Subtraction(A=division, B=tsup_2)
neg = Negative(Value=division_2)
neg_2 = Negative(Value=subtraction)
dom = ConstructDomain(DomainStart=neg, DomainEnd=division_2)
dom_2 = ConstructDomain(DomainStart=Slider(0, range=0..100), DomainEnd=subtraction_2)
dom_3 = ConstructDomain(DomainStart=neg_2, DomainEnd=Slider(0, range=0..100))
rectangle = Rectangle(Plane=PlaneXY(0, 0, 0), XSize=dom, YSize=dom_2, Radius=0)  # -> Rectangle, Length
rectangle_2 = Rectangle(Plane=PlaneXY(0, 0, 0), XSize=dom, YSize=dom_3, Radius=0)  # -> Rectangle, Length
explode = Explode(Curve=rectangle_2.Rectangle, Recursive=True)  # -> Segments, Vertices
item = ListItem(List=explode.Segments, Index=0, Wrap=True)  # -> Item, Item1, Item2, Item3
end = EndPoints(Curve=item.Item2)  # -> Start, End
aligndim = AlignedDimension(Plane=PlaneXY(0, 0, 0), PointA=end.Start, PointB=end.End, Offset=Slider(0, range=0..1), Text="{0:0.00}", Size="0.01")

# ----
division_3 = Division(A=bsup_2, B=2)
division_4 = Division(A=tsup_2, B=2)
subtraction_3 = Subtraction(A=division, B=division_4)
pt = ConstructPoint(XCoordinate=0, YCoordinate=subtraction_3, ZCoordinate=0)
neg_3 = Negative(Value=division_3)
neg_4 = Negative(Value=division_4)
xy = XYPlane(Origin=pt)
dom_4 = ConstructDomain(DomainStart=neg_3, DomainEnd=division_3)
dom_5 = ConstructDomain(DomainStart=neg_4, DomainEnd=division_4)
rectangle_3 = Rectangle(Plane=xy, XSize=dom_4, YSize=dom_5, Radius=0)  # -> Rectangle, Length

division_5 = Division(A=binf_2, B=2)
division_6 = Division(A=tinf_2, B=2)
subtraction_4 = Subtraction(A=division, B=division_6)
neg_5 = Negative(Value=subtraction_4)
pt_2 = ConstructPoint(XCoordinate=0, YCoordinate=neg_5, ZCoordinate=0)
neg_6 = Negative(Value=division_5)
neg_7 = Negative(Value=division_6)
xy_2 = XYPlane(Origin=pt_2)
dom_6 = ConstructDomain(DomainStart=neg_6, DomainEnd=division_5)
dom_7 = ConstructDomain(DomainStart=neg_7, DomainEnd=division_6)
rectangle_4 = Rectangle(Plane=xy_2, XSize=dom_6, YSize=dom_7, Radius=0)  # -> Rectangle, Length

srf = Surface([rectangle_2.Rectangle, rectangle.Rectangle])
join = BrepJoin(Breps=srf)  # -> Breps, Closed
fmerge = MergeFaces(Brep=join.Breps)  # -> Breps, Before, After
crv = Curve(fmerge.Breps)

# ---- group: sezione rettangolare (continued)
explode_2 = Explode(Curve=crv, Recursive=True)  # -> Segments, Vertices
item_2 = ListItem(List=explode_2.Segments, Index=0, Wrap=True)  # -> Item, Item1, Item2, Item3
end_2 = EndPoints(Curve=item_2.Item2)  # -> Start, End
aligndim_2 = AlignedDimension(Plane=PlaneXY(0, 0, 0), PointA=end_2.Start, PointB=end_2.End, Offset=multiplication, Text="{0:0.00}", Size="0.01")

# ----
explode_3 = Explode(Curve=rectangle_4.Rectangle, Recursive=True)  # -> Segments, Vertices
explode_4 = Explode(Curve=rectangle_3.Rectangle, Recursive=True)  # -> Segments, Vertices
item_3 = ListItem(List=explode_3.Segments, Index=0, Wrap=True)  # -> Item, Item1, Item2, Item3
item_4 = ListItem(List=explode_4.Segments, Index=0, Wrap=True)  # -> Item, Item1, Item2, Item3
end_3 = EndPoints(Curve=item_3.Item)  # -> Start, End
end_4 = EndPoints(Curve=item_3.Item3)  # -> Start, End
end_5 = EndPoints(Curve=item_4.Item2)  # -> Start, End
end_6 = EndPoints(Curve=item_4.Item3)  # -> Start, End
aligndim_3 = AlignedDimension(Plane=PlaneXY(0, 0, 0), PointA=end_3.Start, PointB=end_3.End, Offset=number_slider, Text="{0:0.00}", Size="0.01")
aligndim_4 = AlignedDimension(Plane=PlaneXY(0, 0, 0), PointA=end_4.Start, PointB=end_4.End, Offset=number_slider, Text="{0:0.00}", Size="0.01")
aligndim_5 = AlignedDimension(Plane=PlaneXY(0, 0, 0), PointA=end_5.Start, PointB=end_5.End, Offset=number_slider, Text="{0:0.00}", Size="0.01")
aligndim_6 = AlignedDimension(Plane=PlaneXY(0, 0, 0), PointA=end_6.Start, PointB=end_6.End, Offset=number_slider, Text="{0:0.00}", Size="0.01")
merge = Merge(Data1=rectangle_3.Rectangle, Data2=crv, Data3=rectangle_4.Rectangle)  # -> flatten(Result)
crv_2 = Curve(merge)
polyc = Curve(crv_2)
polyc_2 = ClusterOutput(polyc)

# ==== cluster Cluster_3
H = ClusterInput()
th = ClusterInput()
tb = ClusterInput()
B = ClusterInput()
th_2 = Number(th)
H_2 = Number(H)
B_2 = Number(B)
tb_2 = Number(tb)

# ---- group: sezione rettangolare
division = Division(A=H_2, B=2)
division_2 = Division(A=th_2, B=2)
subtraction = Subtraction(A=division, B=tb_2)
neg = Negative(Value=division_2)
dom = ConstructDomain(DomainStart=neg, DomainEnd=division_2)

# ----
division_3 = Division(A=B_2, B=2)
division_4 = Division(A=tb_2, B=2)
subtraction_2 = Subtraction(A=division, B=division_4)
pt = ConstructPoint(XCoordinate=0, YCoordinate=subtraction_2, ZCoordinate=0)
neg_2 = Negative(Value=division_3)
neg_3 = Negative(Value=division_4)
xy = XYPlane(Origin=pt)
dom_2 = ConstructDomain(DomainStart=neg_2, DomainEnd=division_3)
dom_3 = ConstructDomain(DomainStart=neg_3, DomainEnd=division_4)
rectangle = Rectangle(Plane=xy, XSize=dom_2, YSize=dom_3, Radius=0)  # -> Rectangle, Length

division_5 = Division(A=th_2, B=2)
subtraction_3 = Subtraction(A=division, B=division_5)
neg_4 = Negative(Value=subtraction_3)
pt_2 = ConstructPoint(XCoordinate=0, YCoordinate=neg_4, ZCoordinate=0)
xy_2 = XYPlane(Origin=pt_2)
rectangle_2 = Rectangle(Plane=xy_2, XSize=dom_2, YSize=dom_3, Radius=0)  # -> Rectangle, Length

neg_5 = Negative(Value=subtraction)
subtraction_4 = Subtraction(A=division_3, B=division_4)

# ---- group: sezione rettangolare (continued)
dom_4 = ConstructDomain(DomainStart=neg_5, DomainEnd=subtraction)
rectangle_3 = Rectangle(Plane=PlaneXY(0, 0, 0), XSize=dom, YSize=dom_4, Radius=0)  # -> Rectangle, Length

# ----
neg_6 = Negative(Value=subtraction_4)
X = UnitX(Factor=subtraction_4)
X_2 = UnitX(Factor=neg_6)
move = Move(Geometry=rectangle_3.Rectangle, Motion=[X, X_2])  # -> Geometry, Transform
merge = Merge(Data1=rectangle.Rectangle, Data2=rectangle_2.Rectangle, Data3=move.Geometry)  # -> flatten(Result)
crv = Curve(merge)
polyc = Curve(crv)
polyc_2 = ClusterOutput(polyc)
