# Grasshopper definition SectionNLAlpaca4d3.gh (Grasshopper 1.0.7)
# plug-ins: GH_CPython

number_slider = Slider(12, range=0..100)

# ---- group: Material
multiplication = Multiplication(A="-14.17", B=1000)
multiplication_2 = Multiplication(A="-14.17", B=1000)
multiplication_3 = Multiplication(A="200000.0", B=1000)
multiplication_4 = Multiplication(A="391.3", B=1000)
# material
uemc01 = UniaxialElasticMaterialConcreate01Alpaca4d(fc=multiplication, fcu=multiplication_2, ec0="-0.002", ecu="-0.0035")  # -> out, uniAxialMaterial
# ---------- uemc01: Python ----------
"""
Create a uniaxial Elastic Material Concreate01
-
    Args:
        fc:
        fcu:
        ec0:
        ecu:
    Returns:
        uniAxialMaterial:
"""

ghenv.Component.Name = "uniaxial Elastic Material Concreate01 (Alpaca4d)"
ghenv.Component.NickName = 'UEMC01'
ghenv.Component.Message = "uniaxial Concreate01 (Alpaca4d)"

import sys
import Rhino.Geometry as rg
import Grasshopper as gh
import copy


## add alpaca install directory to system path

ghcompfolder = gh.Folders.DefaultAssemblyFolder
if ghcompfolder not in sys.path:
    sys.path.append(ghcompfolder)

try:
    from Alpaca4d import alpaca4d as alpaca
except:
    msg = "Cannot import Alpaca4d. Is the Alpaca4d folder available in " + ghcompfolder + "?"
    ghenv.Component.AddRuntimeMessage(gh.Kernel.GH_RuntimeMessageLevel.Error, msg)


checkData = True

if not fc:
    checkData = False
    msg = "Input parameter fc failed to collect data"
    ghenv.Component.AddRuntimeMessage(gh.Kernel.GH_RuntimeMessageLevel.Warning, msg)

if fcu == 'None':
    checkData = False
    msg = "Input parameter fcu failed to collect data"
    ghenv.Component.AddRuntimeMessage(gh.Kernel.GH_RuntimeMessageLevel.Warning, msg)

if not ec0:
    checkData = False
    msg = "Input parameter ec0 failed to collect data"
    ghenv.Component.AddRuntimeMessage(gh.Kernel.GH_RuntimeMessageLevel.Warning, msg)

if not ecu:
    checkData = False
    msg = "Input parameter ecu failed to collect data"
    ghenv.Component.AddRuntimeMessage(gh.Kernel.GH_RuntimeMessageLevel.Warning, msg)


class uniAxialMaterialConcreate01(object):
    def __init__(self, matName, fc, ec0, fcu, ecu):
        '''Generate a uniaxial Elastic Material Concreate01
            link for information: https://opensees.berkeley.edu/wiki/index.php/Concrete01_Material_--_Zero_Tensile_Strength
            Inputs:
                matName: Name of the material.
                fc:  concrete compressive strength at 28 days (compression is negative) [MPa].
                fcu: concrete crushing strength[MPa].
                ec0: concrete strain at maximum strength.
                ecu: concrete strain at crushing strength.'''


        self.matName = matName
        self.fc = fc
        self.fcu = fcu
        self.ec0 = ec0
        self.ecu = ecu

        self.matTag = None

        self.materialDimension = "uniAxialMaterial"
        self.materialType = "Concrete01"

    def ToString(self):
        return self.write_tcl()

    def write_tcl(self):
        a = "uniaxialMaterial Concrete01 {} {} {} {} {}\n".format(self.matTag, self.fc, self.ec0, self.fcu, self.ecu)
        #b = "uniaxialMaterial MinMax {} {} -min {} -max {}\n".format(self.matTag + 1, self.matTag, self.ecu, 0.0)
        return a #+ b
        
    def write_py(self):
        return "ops.uniaxialMaterial('Concrete01', {}, {}, {}, {}, {})\n".format(self.matTag, self.fc, self.ec0, self.fcu, self.ecu)


if checkData:
    uniAxialMaterial = uniAxialMaterialConcreate01(name, fc, ec0, fcu, ecu)
# ---------- end uemc01 ----------
uems01 = UniaxialElasticMaterialSteel01Alpaca4d(fy=multiplication_4, E0=multiplication_3, b="0.0")  # -> out, uniAxialMaterial
# ---------- uems01: Python ----------
"""
Create a uniaxial Elastic Material Concreate01
-
    Args:
        fc:
        fcu:
        ec0:
        ecu:
    Returns:
        uniAxialMaterial:
"""

ghenv.Component.Name = "uniaxial Elastic Material Steel01 (Alpaca4d)"
ghenv.Component.NickName = 'UEMS01'
ghenv.Component.Message = "uniaxial Steel01 (Alpaca4d)"

import sys
import Rhino.Geometry as rg
import Grasshopper as gh
import copy


## add alpaca install directory to system path

ghcompfolder = gh.Folders.DefaultAssemblyFolder
if ghcompfolder not in sys.path:
    sys.path.append(ghcompfolder)


   
   
try:
    from Alpaca4d import alpaca4d as alpaca
except:
    msg = "Cannot import Alpaca4d. Is the Alpaca4d folder available in " + ghcompfolder + "?"
    ghenv.Component.AddRuntimeMessage(gh.Kernel.GH_RuntimeMessageLevel.Error, msg)

print(a1!=None, a2, a3, a4)

checkData = True

if not fy:
    checkData = False
    msg = "Input parameter fy failed to collect data"
    ghenv.Component.AddRuntimeMessage(gh.Kernel.GH_RuntimeMessageLevel.Warning, msg)

if not E0:
    checkData = False
    msg = "Input parameter E0 failed to collect data"
    ghenv.Component.AddRuntimeMessage(gh.Kernel.GH_RuntimeMessageLevel.Warning, msg)

"""
if not b:
    checkData = False
    msg = "Input parameter b failed to collect data"
    ghenv.Component.AddRuntimeMessage(gh.Kernel.GH_RuntimeMessageLevel.Warning, msg)
"""

class uniAxialMaterialSteel01(object):
    def __init__(self, matName, fy, E0, b, a1, a2, a3, a4):
        '''Generate a uniaxial Elastic Material Steel01
            link for information: https://opensees.berkeley.edu/wiki/index.php/Steel01_Material
            Inputs:
                matName: Name of the material.
                fy: yield strength [MPa].
                E0: initial elastic tangent[MPa].
                b: strain-hardening ratio (ratio between post-yield tangent and initial elastic tangent).
                a1: isotropic hardening parameter, increase of compression yield envelope as proportion of yield strength after a plastic strain of $a2*($Fy/E0). (optional).
                a2: isotropic hardening parameter (see explanation under $a1). (optional).
                a3: isotropic hardening parameter, increase of tension yield envelope as proportion of yield strength after a plastic strain of $a4*($Fy/E0). (optional)
                a4: isotropic hardening parameter (see explanation under $a3). (optional)'''

        self.matName = matName
        self.fy = fy
        self.E0 = E0
        self.b = b
        self.a1 = a1
        self.a2 = a2
        self.a3 = a3
        self.a4 = a4

        self.matTag = None
        
        self.materialDimension = "uniAxialMaterial"
        self.materialType = "Steel01"
        
        self.esh = self.fy/self.E0
        self.eult = 6.75/100

    def ToString(self):
        return self.write_tcl()

    def write_tcl(self):
        if a1 != None and a2 == None and a3 == None and a4 == None:
            return "uniaxialMaterial Steel01 {} {} {} {} {}\n".format(self.matTag, self.fy, self.E0, self.b, self.a1)
        elif a1 != None and a2 != None and a3 == None and a4 == None:
            return "uniaxialMaterial Steel01 {} {} {} {} {} {}\n".format(self.matTag, self.fy, self.E0, self.b, self.a1, self.a2) 
        elif a1 != None and a2 != None and a3 != None and a4 == None:
            return "uniaxialMaterial Steel01 {} {} {} {} {} {} {}\n".format(self.matTag, self.fy, self.E0, self.b, self.a1, self.a2, self.a3) 
        elif a1 != None and a2 != None and a3 != None and a4 != None:
            return "uniaxialMaterial Steel01 {} {} {} {} {} {} {} {}\n".format(self.matTag, self.fy, self.E0, self.b, self.a1, self.a2, self.a3,  self.a4) 
        else:
            a = "uniaxialMaterial Steel01 {} {} {} {}\n".format(self.matTag, self.fy, self.E0, self.b)
            #b = "uniaxialMaterial MinMax {} {} -min {} -max {}\n".format(self.matTag + 1, self.matTag, -self.eult, self.eult)
            return a #+ b
    def write_py(self):
        if a1 != None and a2 == None and a3 == None and a4 == None:
            return "ops.uniaxialMaterial('Steel01', {}, {}, {}, {}, {})\n".format(self.matTag, self.fy, self.E0, self.b, self.a1)
        elif a1 != None and a2 != None and a3 == None and a4 == None:
            return "ops.uniaxialMaterial('Steel01', {}, {}, {}, {}, {}, {})\n".format(self.matTag, self.fy, self.E0, self.b, self.a1, self.a2) 
        elif a1 != None and a2 != None and a3 != None and a4 == None:
            return "ops.uniaxialMaterial('Steel01', {}, {}, {}, {}, {}, {}, {})\n".format(self.matTag, self.fy, self.E0, self.b, self.a1, self.a2, self.a3) 
        elif a1 != None and a2 != None and a3 != None and a4 != None:
            return "ops.uniaxialMaterial('Steel01', {}, {}, {}, {}, {}, {}, {}, {})\n".format(self.matTag, self.fy, self.E0, self.b, self.a1, self.a2, self.a3,  self.a4) 
        else:
            return "ops.uniaxialMaterial('Steel01', {}, {}, {}, {})\n".format(self.matTag, self.fy, self.E0, self.b)


if checkData:
    uniAxialMaterial = uniAxialMaterialSteel01(name, fy, E0, b, a1, a2, a3, a4)


"""
class uniAxialMaterialSteel01(object):
    def __init__(self, matName, fy, E0, b, a1, a2, a3, a4):
        '''Generate a uniaxial Elastic Material Steel01
            link for information: https://opensees.berkeley.edu/wiki/index.php/Steel01_Material
            Inputs:
                matName: Name of the material.
                fy: yield strength [MPa].
                E0: initial elastic tangent[MPa].
                b: strain-hardening ratio (ratio between post-yield tangent and initial elastic tangent).
                a1: isotropic hardening parameter, increase of compression yield envelope as proportion of yield strength after a plastic strain of $a2*($Fy/E0). (optional).
                a2: isotropic hardening parameter (see explanation under $a1). (optional).
                a3: isotropic hardening parameter, increase of tension yield envelope as proportion of yield strength after a plastic strain of $a4*($Fy/E0). (optional)
                a4: isotropic hardening parameter (see explanation under $a3). (optional)'''

        self.matName = matName
        self.fy = fy
        self.E0 = E0
        self.b = b
        self.a1 = a1
        self.a2 = a2
        self.a3 = a3
        self.a4 = a4

        self.matTag = None

        self.materialDimension = "uniAxialMaterial"
        self.materialType = "Steel01"

    def ToString(self):
        return self.write_tcl()

    def write_tcl(self):
        if a1 != None and a2 == None and a3 == None and a4 == None:
            return "uniaxialMaterial Steel01 {} {} {} {} {}\n".format(self.matTag, self.fy, self.E0, self.b, self.a1)
        elif a1 != None and a2 != None and a3 == None and a4 == None:
            return "uniaxialMaterial Steel01 {} {} {} {} {} {}\n".format(self.matTag, self.fy, self.E0, self.b, self.a1, self.a2) 
        elif a1 != None and a2 != None and a3 != None and a4 == None:
            return "uniaxialMaterial Steel01 {} {} {} {} {} {} {}\n".format(self.matTag, self.fy, self.E0, self.b, self.a1, self.a2, self.a3) 
        elif a1 != None and a2 != None and a3 != None and a4 != None:
            return "uniaxialMaterial Steel01 {} {} {} {} {} {} {} {}\n".format(self.matTag, self.fy, self.E0, self.b, self.a1, self.a2, self.a3,  self.a4) 
        else:
            return "uniaxialMaterial Steel01 {} {} {} {}\n".format(self.matTag, self.fy, self.E0, self.b)
    def write_py(self):
        if a1 != None and a2 == None and a3 == None and a4 == None:
            return "ops.uniaxialMaterial('Steel01', {}, {}, {}, {}, {})\n".format(self.matTag, self.fy, self.E0, self.b, self.a1)
        elif a1 != None and a2 != None and a3 == None and a4 == None:
            return "ops.uniaxialMaterial('Steel01', {}, {}, {}, {}, {}, {})\n".format(self.matTag, self.fy, self.E0, self.b, self.a1, self.a2) 
        elif a1 != None and a2 != None and a3 != None and a4 == None:
            return "ops.uniaxialMaterial('Steel01', {}, {}, {}, {}, {}, {}, {})\n".format(self.matTag, self.fy, self.E0, self.b, self.a1, self.a2, self.a3) 
        elif a1 != None and a2 != None and a3 != None and a4 != None:
            return "ops.uniaxialMaterial('Steel01', {}, {}, {}, {}, {}, {}, {}, {})\n".format(self.matTag, self.fy, self.E0, self.b, self.a1, self.a2, self.a3,  self.a4) 
        else:
            return "ops.uniaxialMaterial('Steel01', {}, {}, {}, {})\n".format(self.matTag, self.fy, self.E0, self.b)
"""
# ---------- end uems01 ----------
panel = Panel(uemc01.uniAxialMaterial)
panel_2 = Panel(uems01.uniAxialMaterial)

# ---- group: sezione rettangolare
number_slider_2 = Slider(0.03, range=0..0.1)
division = Division(A=Slider(0.6, range=0..1), B=2)
division_2 = Division(A=Slider(0.3, range=0..1), B=2)
neg = Negative(Value=division)
neg_2 = Negative(Value=division_2)
neg_3 = Negative(Value=number_slider_2)
dom = ConstructDomain(DomainStart=neg, DomainEnd=division)
# Section shape
dom_2 = ConstructDomain(DomainStart=neg_2, DomainEnd=division_2)
rectangle = Rectangle(Plane=PlaneXY(0, 0, 0), XSize=dom_2, YSize=dom, Radius=0)  # -> Rectangle, Length
offset = OffsetCurve(Curve=rectangle.Rectangle, Distance=neg_3, Plane=PlaneXY(0, 0, 0), Corners=1)
explode = Explode(Curve=offset, Recursive=True)  # -> Segments, Vertices
item = ListItem(List=explode.Segments, Index=0, Wrap=True)  # -> Item, Item1, Item2, Item3
crv = Curve(item.Item2)
crv_2 = Curve(item.Item)

# ---- group: Element
data = Data(0)
data_2 = Data(0)

# ---- group: Load
data_3 = Data(0)
data_4 = Data(0)

# ---- group: Cross-Section
data_5 = Data(0)
data_6 = Data(0)

# ---- group: Support
data_7 = Data(0)
data_8 = Data(0)

# ----
division_3 = Division(A=number_slider, B=Slider(1000, range=0..1000))

# ---- group: Constraint
data_9 = Data(0)
data_10 = Data(0)

# ---- group: Material
data_11 = Data(0)
data_12 = Data(0)

# ----
addition = Addition(A=number_slider_2, B=division_3)
explode_2 = Explode(Curve=rectangle.Rectangle, Recursive=True)  # -> Segments, Vertices
item_2 = ListItem(List=explode_2.Segments, Index=0, Wrap=True)  # -> Item, Item1, Item2, Item3
end = EndPoints(Curve=item_2.Item)  # -> Start, End
end_2 = EndPoints(Curve=item_2.Item1)  # -> Start, End
aligndim = AlignedDimension(
    Plane=PlaneXY(0, 0, 0),
    PointA=end.Start,
    PointB=end.End,
    Offset=Slider(-0.1, range=-10..10),
    Text="{0:0.00}",
    Size="0.02")
aligndim_2 = AlignedDimension(
    Plane=PlaneXY(0, 0, 0),
    PointA=end_2.Start,
    PointB=end_2.End,
    Offset=Slider(-0.1, range=-10..10),
    Text="{0:0.00}",
    Size="0.02")

# ----
# patch & layer
P = PathAlpaca4d(material=uemc01.uniAxialMaterial, polyC=rectangle.Rectangle, U=Slider(20, range=0..20), V=Slider(50, range=0..100))  # -> out, path, pathSurf; inputs polyC: Curve, U: Int32, V: Int32
# ---------- P: Python ----------
"""
Create path
-
    Args:
        material: material component.
        polyC: polyline with 4 node (only 4 node).
        U:  number of subdivisions (fibers) in the IJ direction.
        V: 	number of subdivisions (fibers) in the JK direction.
            Inputs:
                
                
                
            
    Returns:
        uniAxialMaterial:
"""

ghenv.Component.Name = "path (Alpaca4d)"
ghenv.Component.NickName = 'P'
ghenv.Component.Message = "path (Alpaca4d)"

import sys
import Rhino.Geometry as rg
import Grasshopper as gh
import copy


## add alpaca install directory to system path

ghcompfolder = gh.Folders.DefaultAssemblyFolder
if ghcompfolder not in sys.path:
    sys.path.append(ghcompfolder)

try:
    from Alpaca4d import alpaca4d as alpaca
except:
    msg = "Cannot import Alpaca4d. Is the Alpaca4d folder available in " + ghcompfolder + "?"
    ghenv.Component.AddRuntimeMessage(gh.Kernel.GH_RuntimeMessageLevel.Error, msg)


checkData = True

if not material:
    checkData = False
    msg = "Input parameter material failed to collect data"
    ghenv.Component.AddRuntimeMessage(gh.Kernel.GH_RuntimeMessageLevel.Warning, msg)

if not polyC:
    checkData = False
    msg = "Input parameter polyC failed to collect data"
    ghenv.Component.AddRuntimeMessage(gh.Kernel.GH_RuntimeMessageLevel.Warning, msg)

if not U:
    checkData = False
    msg = "Input parameter U failed to collect data"
    ghenv.Component.AddRuntimeMessage(gh.Kernel.GH_RuntimeMessageLevel.Warning, msg)

if not V:
    checkData = False
    msg = "Input parameter V failed to collect data"
    ghenv.Component.AddRuntimeMessage(gh.Kernel.GH_RuntimeMessageLevel.Warning, msg)

import rhinoscriptsyntax as rs
import Rhino.Geometry as rg
import ghpythonlib.components as ghcomp

#a = rg.Mesh.CreateFromSurface(surf4N, rg.MeshingParameters.Default)


class path(object):
    def __init__(self, material, polyC, U, V):
        """ Generate fiber
            link for information: https://opensees.berkeley.edu/wiki/index.php/Patch_Command
            Inputs:
                matName: Name of the material.
                U:  number of subdivisions (fibers) in the IJ direction.
                V: 	number of subdivisions (fibers) in the JK direction.
        """
        
        self.material = material
        self.polyC = polyC
        self.U = U 
        self.V = V
        
        self.Point = [polyC.Point(i) for i in range(0,4)]
        # Da perfezionare per far avere sempre la stessa direzione
        if self.Point[0].X <= self.Point[1].X:
            print("direction mesh is good")
            
        else:
            print( "non va bene" )
            self.Point.reverse()
            
        self.surf = ghcomp.MeshSurface(polyC, self.U, self.V, True, True)

    def ToString(self):
        return self.write_tcl()

    def write_tcl(self):
        return "patch quad {} {} {} {} {} {} {} {} {} {} {};\n".format(self.material.matTag, self.U, self.V, self.Point[0].X, self.Point[0].Y, self.Point[1].X, self.Point[1].Y, self.Point[2].X, self.Point[2].Y, self.Point[3].X, self.Point[3].Y  )

if checkData:
    mat = copy.copy(material)
    path = path(mat, polyC, U, V)
    pathSurf = path.surf
# ---------- end P ----------
l = LayerAlpaca4d(material=uems01.uniAxialMaterial, line=crv_2, nBar=Slider(4, range=0..10), diameter=number_slider)  # -> out, layer, layerCircle; inputs line: Curve, nBar: Int32, diameter: Int32
# ---------- l: Python ----------
"""
Create path
-
    Args:
        material: material component.
        polyC: polyline with 4 node (only 4 node).
        nBar:  number of fibers along line
        diameter: 	diameter bar (mm)
            Inputs:
                
                
                
            
    Returns:
        uniAxialMaterial:
"""

ghenv.Component.Name = "layer (Alpaca4d)"
ghenv.Component.NickName = 'l'
ghenv.Component.Message = "layer (Alpaca4d)"

import sys
import Rhino.Geometry as rg
import Grasshopper as gh
import copy


## add alpaca install directory to system path

ghcompfolder = gh.Folders.DefaultAssemblyFolder
if ghcompfolder not in sys.path:
    sys.path.append(ghcompfolder)

try:
    from Alpaca4d import alpaca4d as alpaca
except:
    msg = "Cannot import Alpaca4d. Is the Alpaca4d folder available in " + ghcompfolder + "?"
    ghenv.Component.AddRuntimeMessage(gh.Kernel.GH_RuntimeMessageLevel.Error, msg)


checkData = True

if not material:
    checkData = False
    msg = "Input parameter material failed to collect data"
    ghenv.Component.AddRuntimeMessage(gh.Kernel.GH_RuntimeMessageLevel.Warning, msg)

if not line:
    checkData = False
    msg = "Input parameter line failed to collect data"
    ghenv.Component.AddRuntimeMessage(gh.Kernel.GH_RuntimeMessageLevel.Warning, msg)

if not nBar:
    checkData = False
    msg = "Input parameter nBar failed to collect data"
    ghenv.Component.AddRuntimeMessage(gh.Kernel.GH_RuntimeMessageLevel.Warning, msg)

if not diameter:
    checkData = False
    msg = "Input parameter diameter failed to collect data"
    ghenv.Component.AddRuntimeMessage(gh.Kernel.GH_RuntimeMessageLevel.Warning, msg)

import rhinoscriptsyntax as rs
import Rhino.Geometry as rg
import math as mt
import ghpythonlib.components as ghcomp

#a = rg.Mesh.CreateFromSurface(surf4N, rg.MeshingParameters.Default)


class layer(object):
    def __init__(self, material, line, nBar, diameter):
        """ Generate fiber
            link for information: https://opensees.berkeley.edu/wiki/index.php/Layer_Command
            Inputs:
                matName: Name of the material.
                nBar:  number of fibers along line
        """
        
        self.material = material
        self.line = line
        self.nBar = nBar 
        self.diameter = diameter/1000
        
        area = mt.pi*self.diameter**2/4
        self.Atot = area#*self.nBar 
        pAt = self.line.DivideByCount(self.nBar - 1, True)
        self.Point = [ self.line.PointAt(pAt[i]) for i in range(len(pAt))]
        self.layerSurf = [ rg.Circle(iPoint, self.diameter/2) for iPoint in self.Point ]
        
        

    def ToString(self):
        return self.write_tcl()

    def write_tcl(self):
        return "layer straight {} {} {} {} {} {} {};\n".format(self.material.matTag, self.nBar, self.Atot, self.line.PointAtStart.X, self.line.PointAtStart.Y, self.line.PointAtEnd.X, self.line.PointAtEnd.Y )


if checkData:
    mat = copy.copy(material)
    layer = layer(mat, line, nBar, diameter)
    layerCircle = layer.layerSurf
# ---------- end l ----------
l_2 = LayerAlpaca4d(material=uems01.uniAxialMaterial, line=crv, nBar=Slider(4, range=0..10), diameter=Slider(12, range=0..100))  # -> out, layer, layerCircle; inputs line: Curve, nBar: Int32, diameter: Int32
# ---------- l_2: Python ----------
"""
Create path
-
    Args:
        material: material component.
        polyC: polyline with 4 node (only 4 node).
        nBar:  number of fibers along line
        diameter: 	diameter bar (mm)
            Inputs:
                
                
                
            
    Returns:
        uniAxialMaterial:
"""

ghenv.Component.Name = "layer (Alpaca4d)"
ghenv.Component.NickName = 'l'
ghenv.Component.Message = "layer (Alpaca4d)"

import sys
import Rhino.Geometry as rg
import Grasshopper as gh
import copy


## add alpaca install directory to system path

ghcompfolder = gh.Folders.DefaultAssemblyFolder
if ghcompfolder not in sys.path:
    sys.path.append(ghcompfolder)

try:
    from Alpaca4d import alpaca4d as alpaca
except:
    msg = "Cannot import Alpaca4d. Is the Alpaca4d folder available in " + ghcompfolder + "?"
    ghenv.Component.AddRuntimeMessage(gh.Kernel.GH_RuntimeMessageLevel.Error, msg)


checkData = True

if not material:
    checkData = False
    msg = "Input parameter material failed to collect data"
    ghenv.Component.AddRuntimeMessage(gh.Kernel.GH_RuntimeMessageLevel.Warning, msg)

if not line:
    checkData = False
    msg = "Input parameter line failed to collect data"
    ghenv.Component.AddRuntimeMessage(gh.Kernel.GH_RuntimeMessageLevel.Warning, msg)

if not nBar:
    checkData = False
    msg = "Input parameter nBar failed to collect data"
    ghenv.Component.AddRuntimeMessage(gh.Kernel.GH_RuntimeMessageLevel.Warning, msg)

if not diameter:
    checkData = False
    msg = "Input parameter diameter failed to collect data"
    ghenv.Component.AddRuntimeMessage(gh.Kernel.GH_RuntimeMessageLevel.Warning, msg)

import rhinoscriptsyntax as rs
import Rhino.Geometry as rg
import math as mt
import ghpythonlib.components as ghcomp

#a = rg.Mesh.CreateFromSurface(surf4N, rg.MeshingParameters.Default)


class layer(object):
    def __init__(self, material, line, nBar, diameter):
        """ Generate fiber
            link for information: https://opensees.berkeley.edu/wiki/index.php/Layer_Command
            Inputs:
                matName: Name of the material.
                nBar:  number of fibers along line
        """
        
        self.material = material
        self.line = line
        self.nBar = nBar 
        self.diameter = diameter/1000
        
        area = (mt.pi*self.diameter**2/4)
        self.Atot = area #*self.nBar 
        pAt = self.line.DivideByCount(self.nBar - 1, True)
        self.Point = [ self.line.PointAt(pAt[i]) for i in range(len(pAt))]
        self.layerSurf = [ rg.Circle(iPoint, self.diameter/2) for iPoint in self.Point ]
        
        

    def ToString(self):
        return self.write_tcl()

    def write_tcl(self):
        return "layer straight {} {} {} {} {} {} {};\n".format(self.material.matTag, self.nBar, self.Atot, self.line.PointAtStart.X, self.line.PointAtStart.Y, self.line.PointAtEnd.X, self.line.PointAtEnd.Y )


if checkData:
    mat = copy.copy(material)
    layer = layer(mat, line, nBar, diameter)
    layerCircle = layer.layerSurf
# ---------- end l_2 ----------
panel_3 = Panel(P.path)
panel_4 = Panel(l_2.layer)
panel_5 = Panel(l.layer)

srf = Surface([l.layerCircle, l_2.layerCircle])

# ---- group: Cross-Section / FiberSection
# Fiber section
python = GhPythonScript(path=P.path, layer=[l.layer, l_2.layer])  # -> out, FiberSection, FiberMesh, PropSection; inputs path: list, layer: list
# ---------- python: Python ----------
__author__ = "Domen"
__version__ = "2021.08.07"

import rhinoscriptsyntax as rs
import ghpythonlib.components as ghcomp
import Rhino.Geometry as rg

"""
for i, item in enumerate(path):
    print(i, item)
    item.material.matTag = i + 1
"""

class FiberSection(object):
    def __init__(self, path, layer):

        self.path = path
        self.layer = layer
        self.secTag = None

        self.mesh = []
        for item in path:
            self.mesh.append(item.surf)
        self.mesh = ghcomp.Kangaroo2Component.CombineClean(self.mesh)
        calculateProp = rg.AreaMassProperties.Compute(self.mesh)
        self.centerSection = calculateProp.Centroid
        
        # calcolo proprietà della sezione #
        area = 'Area: ' + str(calculateProp.Area)  + '\n'
        centroidC = 'Centroid coordinates: ' + "x: {}, y: {}, z: {} ".format(self.centerSection.X, self.centerSection.Y, self.centerSection.Z) + '\n'
        Inertia = calculateProp.CentroidCoordinatesMomentsOfInertia
        InertiaStr = 'Inertia respect the centroid : ' + "Ixx: {}, Iyy: {}, Izz: {} ".format(Inertia.X, Inertia.Y, Inertia.Z) + '\n'
        self.prop = ''.join([area, centroidC, InertiaStr])

    def ToString(self):
        return self.write_tcl()

    def write_tcl(self):
        section = "section Fiber {} -GJ 10000 {}\n".format(self.secTag, "{;") # -GJ 10000
        # PATH
        pathList = ''.join([ i.ToString() for i in path ])
        # LAYER
        layerList = ''.join([ i.ToString() for i in layer ])
        
        return section + pathList + layerList +"}\n"

    def write_py(self):
        py_text = "ops.section('Elastic',{},{},{},{},{},{},{},{},{})\n".format(self.sectionTag, self.material.E, self.Area, self.Izz, self.Iyy, self.material.G, self.J, self.alphaY, self.alphaZ)
        return py_text


FiberSection = FiberSection(path, layer)
FiberMesh = FiberSection.mesh
PropSection = FiberSection.prop
# ---------- end python ----------

# ---- group: Cross-Section
# Domain Axial force - Bending moment  solver
swatch = ColourSwatch(SwatchColor=RGBA(249, 255, 84, 120))
mcol = MeshColours(Mesh=python.FiberMesh, Colours=swatch)
panel_6 = Panel(python.FiberSection)
panel_7 = Panel(python.PropSection)

# ---- group: 3D
# Bending Moment - curvature  solver
number_slider_3 = Slider(100, range=0..1000)
neg_4 = Negative(Value=number_slider_3)
mcm = MomentCurvatureModelAlpaca4d(
    FiberSection=python.FiberSection,
    P=neg_4,
    direction=Slider(1, range=0..10),
    maxPhi=Slider(0.5, range=0..1),
    nIncr=Slider(1000, range=0..10000))  # -> out, script, k1, k2, k3, M1, M2, M3; inputs direction: Int32, nIncr: Int32
# ---------- mcm: Python ----------
"""
Run an OpenSees Analysis
-
    Args:
        FiberSection:
        P: axial load 
        mu: Target ductility for analysis
        nIncr: Number of analysis increments
    Returns:
        AlpacaSolvedModel:
"""



import Rhino.RhinoDoc
import Grasshopper as gh
import copy
import rhinoscriptsyntax as rs
import Rhino.Geometry as rg
import os
import time
import sys
import subprocess



ghenv.Component.Name = "Moment Curvature Model (Alpaca4d)"
ghenv.Component.NickName = 'MCM'
ghenv.Component.Message = "Moment Curvature Model (Alpaca4d)"

ghcompfolder = gh.Folders.DefaultAssemblyFolder
if ghcompfolder not in sys.path:
    sys.path.append(ghcompfolder)

try:
    from Alpaca4d import alpaca4d as alpaca
except:
    msg = "Cannot import Alpaca4d. Is the Alpaca4d folder available in " + ghcompfolder + "?"
    ghenv.Component.AddRuntimeMessage(gh.Kernel.GH_RuntimeMessageLevel.Error, msg)


checkData = True



if not FiberSection:
    checkData = False
    msg = "Input parameter AlpacaModel failed to collect data"
    ghenv.Component.AddRuntimeMessage(gh.Kernel.GH_RuntimeMessageLevel.Warning, msg)
if not P: #
    checkData = False
    msg = "Input parameter P failed to collect data"
    ghenv.Component.AddRuntimeMessage(gh.Kernel.GH_RuntimeMessageLevel.Warning, msg)
    
if not direction: #
    checkData = False
    msg = "Input parameter direction failed to collect data"
    ghenv.Component.AddRuntimeMessage(gh.Kernel.GH_RuntimeMessageLevel.Warning, msg)

if not maxPhi: #
    checkData = False
    msg = "Input parameter maxPhi failed to collect data"
    ghenv.Component.AddRuntimeMessage(gh.Kernel.GH_RuntimeMessageLevel.Warning, msg)

if not nIncr: #
    checkData = False
    msg = "Input parameter nIncr failed to collect data"
    ghenv.Component.AddRuntimeMessage(gh.Kernel.GH_RuntimeMessageLevel.Warning, msg)
    
class MomentCurvature(object):
    def __init__(self, section, axialLoad, direction, maxPhi, numIncr=100):
        #^ y
        #|
        #|
        #|------> x
        self.section = section
        self.axialLoad = axialLoad
        self.direction = direction
        self.maxPhi = maxPhi
        self.numIncr= numIncr
        # Compute curvature increment
        #self.dK = self.maxK / self.numIncr
        self.secTag = 1
        

    def ToString(self):
        return self.write_tcl()

    def write_tcl(self):
        # Define two nodes at (0,0)
        clean = "wipe\n"
        model = "model BasicBuilder -ndm 3 -ndf 6\n"
        
        materialPath = ''.join([ i.material.write_tcl() for i in self.section.path ])
        materialLayer = ''.join([ i.material.write_tcl() for i in self.section.layer ])
        material = materialPath + materialLayer
        
        section = self.section.ToString()
        node1 = "node {} {} {} {}\n".format(1, self.section.centerSection.X, self.section.centerSection.Y, self.section.centerSection.Z)
        node2 = "node {} {} {} {}\n".format(2, self.section.centerSection.X, self.section.centerSection.Y, self.section.centerSection.Z)
        # Fix all degrees of freedom except axial and bending
        fix1 = "fix {} {} {} {} {} {} {}\n".format(1, 1, 1, 1, 1 ,1, 1) #node tag Fx Fy Fz Mx My Mz
        fix2 = "fix {} {} {} {} {} {} {}\n".format(2, 0, 1, 1, 1, 0, 0) #node tag Fx Fy Fz Mx My Mz
        # Define element
        ele = "element zeroLengthSection {} {} {} {}\n".format( 1, 1, 2, self.secTag) #-orient 1 0 0 1 0 0
        # Define constant axial load
        pattern = 'pattern Plain {} "{}" {}\n'.format( 1, 'Constant', "{;")   
        load = "load {} {} {} {} {} {} {};\n".format(2, self.axialLoad, 0.0, 0.0, 0.0, 0.0, 0.0) +  "}\n" 
        # analysis for constant axial load
        Integrator = "integrator LoadControl {}\n".format( 0.1)
        System = "system BandGeneral\n" #-piv
        Test = "test NormUnbalance {} {}\n".format( 1e-10, 1000)
        number = "numberer RCM\n"
        constraints = "constraints Plain\n"
        algorithm = "algorithm Newton\n"
        analysis = "analysis Static\n"
        # Do one analysis for constant axial load
        analyze = "analyze {}\n".format(10) 
        lC = "loadConst -time 0.0\n"
        # Define reference moment 
        recorder1 = "recorder Element -file MKsectionForce.out -ele 1 section force\n"
        recorder2 = "recorder Element -file MKsectionDef.out -ele 1 section deformation\n"
        patternM = 'pattern Plain {} "{}" {}\n'.format( 2, 'Linear', "{;")   
        # Use displacement control at node 2 for section analysis
        #IntegratorD = "integrator DisplacementControl {} {} {} {} {} {}\n".format(2,3,0.00035,1,self.dK,self.dK)
        if self.direction == 1 and self.maxPhi >0:
            directionID = 5
            loadM = "load {} {} {} {} {} {} {};\n".format(2, 0.0, 0.0, 0.0, 0.0, self.direction, 0.0) +  "}\n"
            
        elif self.direction == 2 and self.maxPhi >0:
            directionID = 6
            loadM = "load {} {} {} {} {} {} {};\n".format(2, 0.0, 0.0, 0.0, 0.0, 0.0, self.direction) +  "}\n" 
            
        elif self.direction == 1 and self.maxPhi <0:
            directionID = 5
            loadM = "load {} {} {} {} {} {} {};\n".format(2, 0.0, 0.0, 0.0, 0.0, -self.direction, 0.0) +  "}\n" 
            
        elif self.direction == 2 and self.maxPhi <0:
            directionID = 6
            loadM = "load {} {} {} {} {} {} {};\n".format(2, 0.0, 0.0, 0.0, 0.0, 0.0, -self.direction) +  "}\n" 
            
        IntegratorD = "integrator DisplacementControl {} {} {}\n".format(2,directionID,self.maxPhi/self.numIncr)
        #IntegratorD = 'integrator ' + self.Integrator.ToString() + "\n"
        analyze2 = "analyze {}\n".format(self.numIncr) + "\n" + "wipe"+ "\n"

        return clean + model + material + section +  node1 + node2 + fix1 + fix2 + ele + pattern + load + Integrator + System + Test + number + constraints + algorithm + analysis + analyze +lC + recorder1+ recorder2 + patternM + loadM + IntegratorD + analyze2


    def write_py(self):
        # Define two nodes at (0,0)


        return node1 + node2 + fix1 + fix2 + ele  + timeSeries + pattern + load + Integrator + System + test + number + constraints + algorithm + analysis + analyze + timeSeriesM + patternM + loadM + IntegratorD + analyze2


if checkData:
    FiberSection.secTag = 1

    for i, item in enumerate(FiberSection.path):
        item.material.matTag = i + 1
        #print(item.material.matTag )
    j = i+2
    for i, item in enumerate(FiberSection.layer):
        item.material.matTag = j + i
        print(j+i)
    
    MC = MomentCurvature(FiberSection, P, direction, maxPhi, nIncr)

script = MC.write_tcl()
#print(script)

outputFileName = 'openSeesSectionModel'
recorderFileName1 = 'MKsectionForce.out'
recorderFileName2 = 'MKsectionDef.out'

if checkData:
    FolderPath = rs.DocumentPath()
    os.chdir(FolderPath)

    
for dirpath, dirnames, filenames in os.walk(FolderPath):
    for filename in filenames:
        if filename == outputFileName:
            file = os.path.join(dirpath,outputFileName)
            filepath1 = os.path.join(dirpath,recorderFileName1)
            filepath2 = os.path.join(dirpath,recorderFileName2)
        elif filename == recorderFileName1:
            file1 = os.path.join(dirpath,recorderFileName1)
            file2 = os.path.join(dirpath,recorderFileName2)
            os.remove(file1)
            os.remove(file2)

time_start = time.clock()

with open(outputFileName, 'w') as f:
    for line in MC.write_tcl():
        f.write(line)
    f.close()

time_elapsed = (time.clock() - time_start)
#print("Writing Time {}".format(time_elapsed))


time_start = time.clock()

executable = os.path.join(ghcompfolder,'Alpaca4d\OpenSees-Solvers\opensees.bat')

#process = subprocess.Popen([r'C:\OpenSees\bin\OpenSees', outputFileName], shell = True, stdout=subprocess.PIPE, stderr=subprocess.PIPE)
process = subprocess.Popen([executable, outputFileName], shell = True,  stdout=subprocess.PIPE, stderr=subprocess.PIPE)
stdout, stderr = process.communicate()
print(stdout, stderr)
process.kill()

time_elapsed = (time.clock() - time_start)
print("Analyses Time {}".format(time_elapsed))




fileObj = open(filepath1, 'r')
words = fileObj.read().splitlines(" ")
#N = [ float(i.split()[0]) for i in words]
M1 = [ float(i.split()[1]) for i in words]
M2 = [ float(i.split()[2]) for i in words]
M3 = [ float(i.split()[3]) for i in words]
fileObj.close()
#FiberSection = [k, M]

fileObj = open(filepath2, 'r')
words = fileObj.read().splitlines(" ")
#N = [ float(i.split()[0]) for i in words]
k1 = [ float(i.split()[1]) for i in words]
k2 = [ float(i.split()[2]) for i in words]
k3 = [ float(i.split()[3]) for i in words]
fileObj.close()
# ---------- end mcm ----------
panel_8 = Panel(mcm.script)
image = ImageSampler(
    FilePath="C:\Users\Domen\Desktop\Alpaca MC\diagram M-k.png",
    Filter="Colour",
    Interpolate=True,
    Umax=640,
    Umin=1,
    Vmax=480,
    Vmin=1,
    Wrap=0)

# ----
mnm = MNModelAlpaca4d(FiberSection=python.FiberSection)  # -> out, N, k1, k2, k3, M1, M2, M3, M1u, M2u
# ---------- mnm: Python ----------
"""
Run an OpenSees Analysis
-
    Args:
        FiberSection:
        P: axial load 
        mu: Target ductility for analysis
        nIncr: Number of analysis increments
    Returns:
        AlpacaSolvedModel:
"""



import Rhino.RhinoDoc
import Grasshopper as gh
import copy
import rhinoscriptsyntax as rs
import Rhino.Geometry as rg
import os
import time
import sys
import subprocess
import ghpythonlib.treehelpers as th
import math as mt
import ghpythonlib.parallel as ghp



ghenv.Component.Name = "M-N Model (Alpaca4d)"
ghenv.Component.NickName = 'MNM'
ghenv.Component.Message = "M-N Model (Alpaca4d)"

ghcompfolder = gh.Folders.DefaultAssemblyFolder
if ghcompfolder not in sys.path:
    sys.path.append(ghcompfolder)

try:
    from Alpaca4d import alpaca4d as alpaca
except:
    msg = "Cannot import Alpaca4d. Is the Alpaca4d folder available in " + ghcompfolder + "?"
    ghenv.Component.AddRuntimeMessage(gh.Kernel.GH_RuntimeMessageLevel.Error, msg)


checkData = True



if not FiberSection:
    checkData = False
    msg = "Input parameter AlpacaModel failed to collect data"
    ghenv.Component.AddRuntimeMessage(gh.Kernel.GH_RuntimeMessageLevel.Warning, msg)
    
class MomentCurvature(object):
    def __init__(self, recorderName, section, axialLoad, direction, maxPhi, numIncr=100):
        #^ y
        #|
        #|
        #|------> x
        self.recorderName = recorderName
        self.section = section
        self.axialLoad = axialLoad
        self.direction = direction
        self.maxPhi = maxPhi
        self.numIncr= numIncr
        # Compute curvature increment
        #self.dK = self.maxK / self.numIncr
        self.secTag = 1
        

    def ToString(self):
        return self.write_tcl()

    def write_tcl(self):
        # Define two nodes at (0,0)
        clean = "wipe\n"
        model = "model BasicBuilder -ndm 3 -ndf 6\n"
        
        materialPath = ''.join([ i.material.write_tcl() for i in self.section.path ])
        materialLayer = ''.join([ i.material.write_tcl() for i in self.section.layer ])
        material = materialPath + materialLayer
        
        section = self.section.ToString()
        node1 = "node {} {} {} {}\n".format(1, self.section.centerSection.X, self.section.centerSection.Y, self.section.centerSection.Z)
        node2 = "node {} {} {} {}\n".format(2, self.section.centerSection.X, self.section.centerSection.Y, self.section.centerSection.Z)
        # Fix all degrees of freedom except axial and bending
        fix1 = "fix {} {} {} {} {} {} {}\n".format(1, 1, 1, 1, 1 ,1, 1) #node tag Fx Fy Fz Mx My Mz
        fix2 = "fix {} {} {} {} {} {} {}\n".format(2, 0, 1, 1, 1, 0, 0) #node tag Fx Fy Fz Mx My Mz
        # Define element
        ele = "element zeroLengthSection {} {} {} {}\n".format( 1, 1, 2, self.secTag) #-orient 1 0 0 1 0 0
        # Define constant axial load
        pattern = 'pattern Plain {} "{}" {}\n'.format( 1, 'Constant', "{;")   
        load = "load {} {} {} {} {} {} {};\n".format(2, self.axialLoad, 0.0, 0.0, 0.0, 0.0, 0.0) +  "}\n" 
        # analysis for constant axial load
        Integrator = "integrator LoadControl {}\n".format( 0.1)
        System = "system BandGeneral\n" #-piv
        Test = "test NormUnbalance {} {}\n".format( 1e-10, 1000)
        number = "numberer RCM\n"
        constraints = "constraints Plain\n"
        algorithm = "algorithm Newton\n"
        analysis = "analysis Static\n"
        # Do one analysis for constant axial load
        analyze = "analyze {}\n".format(10) 
        lC = "loadConst -time 0.0\n"
        # Define reference moment 
        recorderName1 = self.recorderName + "Force" + ".out"
        recorderName2 = self.recorderName + "Disp" + ".out"
        recorder1 = "recorder Element -file {} -ele 1 section force\n".format(recorderName1)
        recorder2 = "recorder Element -file {} -ele 1 section deformation\n".format(recorderName2)
        patternM = 'pattern Plain {} "{}" {}\n'.format( 2, 'Linear', "{;")   
        # Use displacement control at node 2 for section analysis
        #IntegratorD = "integrator DisplacementControl {} {} {} {} {} {}\n".format(2,3,0.00035,1,self.dK,self.dK)
        if self.direction == 1 and self.maxPhi >0:
            directionID = 5
            loadM = "load {} {} {} {} {} {} {};\n".format(2, 0.0, 0.0, 0.0, 0.0, self.direction, 0.0) +  "}\n"
            
        elif self.direction == 2 and self.maxPhi >0:
            directionID = 6
            loadM = "load {} {} {} {} {} {} {};\n".format(2, 0.0, 0.0, 0.0, 0.0, 0.0, self.direction) +  "}\n" 
            
        elif self.direction == 1 and self.maxPhi <0:
            directionID = 5
            loadM = "load {} {} {} {} {} {} {};\n".format(2, 0.0, 0.0, 0.0, 0.0, -self.direction, 0.0) +  "}\n" 
            
        elif self.direction == 2 and self.maxPhi <0:
            directionID = 6
            loadM = "load {} {} {} {} {} {} {};\n".format(2, 0.0, 0.0, 0.0, 0.0, 0.0, -self.direction) +  "}\n" 
            
        IntegratorD = "integrator DisplacementControl {} {} {} {}\n".format(2,directionID,self.maxPhi/self.numIncr, 20) #node dof incr numIter
        #IntegratorD = 'integrator ' + self.Integrator.ToString() + "\n"
        analyze2 = "analyze {}\n".format(self.numIncr) + "\n" + "wipe"+ "\n"

        return clean + model + material + section +  node1 + node2 + fix1 + fix2 + ele + pattern + load + Integrator + System + Test + number + constraints + algorithm + analysis + analyze +lC + recorder1+ recorder2 + patternM + loadM + IntegratorD + analyze2


    def write_py(self):
        # Define two nodes at (0,0)


        return node1 + node2 + fix1 + fix2 + ele  + timeSeries + pattern + load + Integrator + System + test + number + constraints + algorithm + analysis + analyze + timeSeriesM + patternM + loadM + IntegratorD + analyze2

class AxialForceEpsilon(object):
    def __init__(self, recorderName, section, direction =1, numIncr=2000):
        #^ y
        #|
        #|
        #|------> x
        self.recorderName = recorderName
        self.section = section
        self.direction = direction
        self.numIncr= numIncr
        # Compute curvature increment
        #self.dK = self.maxK / self.numIncr
        self.secTag = 1
        

    def ToString(self):
        return self.write_tcl()

    def write_tcl(self):
        # Define two nodes at (0,0)
        clean = "wipe\n"
        model = "model BasicBuilder -ndm 2 -ndf 3\n"
        
        materialPath = ''.join([ i.material.write_tcl() for i in self.section.path ])
        materialLayer = ''.join([ i.material.write_tcl() for i in self.section.layer ])
        material = materialPath + materialLayer
        
        section = self.section.ToString()
        node1 = "node {} {} {}\n".format(1, self.section.centerSection.X, self.section.centerSection.Y)
        node2 = "node {} {} {}\n".format(2, self.section.centerSection.X, self.section.centerSection.Y)
        # Fix all degrees of freedom except axial and bending
        fix1 = "fix {} {} {} {}\n".format(1, 1, 1, 1) #node tag Fx Fy Fz Mx My Mz
        fix2 = "fix {} {} {} {}\n".format(2, 0, 1, 1) #node tag Fx Fy Fz Mx My Mz
        # Define element
        ele = "element zeroLengthSection {} {} {} {}\n".format( 1, 1, 2, self.secTag) #-orient 1 0 0 1 0 0
        # Define constant axial load

        pattern = 'pattern Plain {} "{}" {}\n'.format( 1, 'Linear', "{;")   
        if self.direction > 0.0:
            dir = 0.1
            load = "load {} {} {} {};\n".format(2, dir, 0.0, 0.0) +  "}\n"
            print("Positive")
        else :
            dir = -0.1
            load = "load {} {} {} {};\n".format(2, dir, 0.0, 0.0) +  "}\n"         
            print("negative")
        recorderName1 = self.recorderName + "Force" + ".out"
        recorderName2 = self.recorderName + "Disp" + ".out"
        recorder1 = "recorder Element -file {} -ele 1 section force\n".format(recorderName1)
        recorder2 = "recorder Element -file {} -ele 1 section deformation\n".format(recorderName2)
        
        
        Integrator = "integrator LoadControl {} {}\n".format(10, 100)
        System = "system BandGeneral\n" #-piv
        Test = "test NormUnbalance {} {}\n".format( 1e-09, 1000)
        number = "numberer RCM\n"
        constraints = "constraints Plain\n"
        algorithm = "algorithm Newton\n"
        analysis = "analysis Static\n"
        # Do one analysis for constant axial load
        analyze = "analyze {}\n".format(self.numIncr) + "\n" + "wipe"+ "\n"
        # Define reference moment 

        return clean + model + material + section +  node1 + node2 + fix1 + fix2 + ele + pattern + load + recorder1+ recorder2 + Integrator + System + Test + number + constraints + algorithm + analysis + analyze 


def RunMCpositive(Pi): 
    if Pi > 0.0:
        recorderFileName = "MKsectionP{}positiveMpositive".format(int(mt.fabs(Pi)))
        outputFileName = "OSSModel{}positiveMpositive".format(int(mt.fabs(Pi)))
    elif Pi < 0.0:
        recorderFileName = "MKsectionP{}negativeMpositive".format(int(mt.fabs(Pi)))
        outputFileName = "OSSModel{}negativeMpositive".format(int(mt.fabs(Pi)))
        
    MC = MomentCurvature(recorderFileName,FiberSection, float(Pi), 1, 1.0, 1000) #mu*FiberSection.Ky
    script = MC.write_tcl()
    
    FolderPath = rs.DocumentPath()
    os.chdir(FolderPath)
        
    recorderFileName1 = recorderFileName + "Force" + ".out"
    recorderFileName2 = recorderFileName + "Disp" + ".out"
    
    runFileName = os.path.join(FolderPath,outputFileName)
    filepath1 = os.path.join(FolderPath,recorderFileName1)
    filepath2 = os.path.join(FolderPath,recorderFileName2)
    
    time_start = time.clock()
    
    with open(outputFileName, 'w') as f:
        for line in MC.write_tcl():
            f.write(line)
        f.close()
    
    time_elapsed = (time.clock() - time_start)
    #print("Writing Time {}".format(time_elapsed))
    
    time_start = time.clock()
    
    executable = os.path.join(ghcompfolder,'Alpaca4d\OpenSees-Solvers\opensees.bat')
    #executable = os.path.join(ghcompfolder,'C:\OpenSees\bin\opensees.bat')
    
    #process = subprocess.Popen([r'C:\OpenSees\bin\OpenSees', outputFileName], shell = True, stdout=subprocess.PIPE, stderr=subprocess.PIPE)
    process = subprocess.Popen([executable, outputFileName], shell = True,  stdout=subprocess.PIPE, stderr=subprocess.PIPE)
    stdout, stderr = process.communicate()
    #print(stdout, stderr)
    process.kill()
    
    time_elapsed = (time.clock() - time_start)
    #print("Analyses Time {}".format(time_elapsed))
    #filepath = os.path.join(r'C:\OpenSees\bin',recorderFileName)
    fileObj = open(filepath1, 'r')
    words = fileObj.read().splitlines(" ")
    #print(fileObj.read())
    N = [ float(i.split()[0]) for i in words]
    M1 = [ float(i.split()[1]) for i in words]
    M2 = [ float(i.split()[2]) for i in words]
    M3 = [ float(i.split()[3]) for i in words]
    fileObj.close()
    os.remove(runFileName)
    os.remove(filepath1)
    fileObj = open(filepath2, 'r')
    words = fileObj.read().splitlines(" ")
    #print(fileObj.read())
    k1 = [ float(i.split()[1]) for i in words]
    k2 = [ float(i.split()[2]) for i in words]
    k3 = [ float(i.split()[3]) for i in words]
    fileObj.close()
    os.remove(filepath2)
    return [k1, k2, k3, N, M1, M2, M3]


def RunMCnegative(Pi): 

    if Pi > 0.0:
        recorderFileName = "MKsectionP{}positiveMnegative".format(int(mt.fabs(Pi)))
        outputFileName = "OSSModel{}positiveMnegative".format(int(mt.fabs(Pi)))
    elif Pi < 0.0:
        recorderFileName = "MKsectionP{}negativeMnegative".format(int(mt.fabs(Pi)))
        outputFileName = "OSSModel{}negativeMnegative".format(int(mt.fabs(Pi)))
        
    MC = MomentCurvature(recorderFileName,FiberSection, float(Pi), 1, -1.0, 1000) #mu*FiberSection.Ky
    script = MC.write_tcl()
    
    FolderPath = rs.DocumentPath()
    os.chdir(FolderPath)
        
    recorderFileName1 = recorderFileName + "Force" + ".out"
    recorderFileName2 = recorderFileName + "Disp" + ".out"
    
    runFileName = os.path.join(FolderPath,outputFileName)
    filepath1 = os.path.join(FolderPath,recorderFileName1)
    filepath2 = os.path.join(FolderPath,recorderFileName2)
    """
    if os.path.exists(runFileName):
      os.remove(runFileName)
    else:
      print("The file does not exist")
    """
    time_start = time.clock()
    
    with open(outputFileName, 'w') as f:
        for line in MC.write_tcl():
            f.write(line)
        f.close()
    
    time_elapsed = (time.clock() - time_start)
    #print("Writing Time {}".format(time_elapsed))
    
    time_start = time.clock()
    
    executable = os.path.join(ghcompfolder,'Alpaca4d\OpenSees-Solvers\opensees.bat')
    #executable = os.path.join(ghcompfolder,'C:\OpenSees\bin\opensees.bat')
    
    #process = subprocess.Popen([r'C:\OpenSees\bin\OpenSees', outputFileName], shell = True, stdout=subprocess.PIPE, stderr=subprocess.PIPE)
    process = subprocess.Popen([executable, outputFileName], shell = True,  stdout=subprocess.PIPE, stderr=subprocess.PIPE)
    stdout, stderr = process.communicate()
    #print(stdout, stderr)
    process.kill()
    
    time_elapsed = (time.clock() - time_start)
    #print("Analyses Time {}".format(time_elapsed))
    #filepath = os.path.join(r'C:\OpenSees\bin',recorderFileName)
    fileObj = open(filepath1, 'r')
    words = fileObj.read().splitlines(" ")
    #print(fileObj.read())
    N = [ float(i.split()[0]) for i in words]
    M1 = [ float(i.split()[1]) for i in words]
    M2 = [ float(i.split()[2]) for i in words]
    M3 = [ float(i.split()[3]) for i in words]
    fileObj.close()
    os.remove(runFileName)
    os.remove(filepath1)
    fileObj = open(filepath2, 'r')
    words = fileObj.read().splitlines(" ")
    #print(fileObj.read())
    k1 = [ float(i.split()[1]) for i in words]
    k2 = [ float(i.split()[2]) for i in words]
    k3 = [ float(i.split()[3]) for i in words]
    fileObj.close()
    os.remove(filepath2)
    return [k1, k2, k3, N, M1, M2, M3]

def RunNEps(dir): 
    print(dir)
    if dir >0 :
        recorderFileName = 'NEpsSectionPositive' # da risolvere per il nome del file
        outputFileName = 'OSSModelNpositive'
    else:
        recorderFileName = 'NEpsSectionNegative' # da risolvere per il nome del file
        outputFileName = 'OSSModelNnegative'
    NEps = AxialForceEpsilon(recorderFileName,FiberSection, dir,5000) #mu*FiberSection.Ky
    script = NEps.write_tcl()

    
    FolderPath = rs.DocumentPath()
    os.chdir(FolderPath)
        
    recorderFileName1 = recorderFileName + "Force" + ".out"
    recorderFileName2 = recorderFileName + "Disp" + ".out"
    
        
    runFileName = os.path.join(FolderPath,outputFileName)
    filepath1 = os.path.join(FolderPath,recorderFileName1)
    filepath2 = os.path.join(FolderPath,recorderFileName2)
    
    if os.path.exists(runFileName):
      os.remove(runFileName)
    else:
      print("The file does not exist")
      
    
    time_start = time.clock()
    
    with open(outputFileName, 'w') as f:
        for line in NEps.write_tcl():
            f.write(line)
        f.close()
    
    time_elapsed = (time.clock() - time_start)
    #print("Writing Time {}".format(time_elapsed))
    
    time_start = time.clock()
    
    executable = os.path.join(ghcompfolder,'Alpaca4d\OpenSees-Solvers\opensees.bat')
    #executable = os.path.join(ghcompfolder,'C:\OpenSees\bin\opensees.bat')
    
    #process = subprocess.Popen([r'C:\OpenSees\bin\OpenSees', outputFileName], shell = True, stdout=subprocess.PIPE, stderr=subprocess.PIPE)
    process = subprocess.Popen([executable, outputFileName], shell = True,  stdout=subprocess.PIPE, stderr=subprocess.PIPE)
    stdout, stderr = process.communicate()
    #print(stdout, stderr)
    process.kill()
    
    time_elapsed = (time.clock() - time_start)
    #print("Analyses Time {}".format(time_elapsed))
    #filepath = os.path.join(r'C:\OpenSees\bin',recorderFileName)
    fileObj = open(filepath1, 'r')
    words = fileObj.read().splitlines(" ")
    #print(fileObj.read())
    N = [ float(i.split()[0]) for i in words]
    fileObj.close()
    os.remove(runFileName)
    os.remove(filepath1)
    fileObj = open(filepath2, 'r')
    words = fileObj.read().splitlines(" ")
    #print(fileObj.read())
    Eps = [ float(i.split()[0]) for i in words]
    fileObj.close()
    os.remove(filepath2)
    
    return N
    
if checkData:
    FiberSection.secTag = 1

    for i, item in enumerate(FiberSection.path):
        item.material.matTag = i + 1
        #print(item.material.matTag )
    j = i+2
    for i, item in enumerate(FiberSection.layer):
        item.material.matTag = j + i
        #print(j+i)
        
        
A = ghp.run(RunNEps,[-1.0, 1.0], True)


def linspace(start, stop, len):
    step = (mt.fabs(start)+stop)/(len-1)
    return [start + step*interval for interval in range(len)]
    
print(min(A),max(A))

n1 = int(mt.fabs(min(A)/100))
n2 = int(mt.fabs(max(A)/10))
listP = linspace(min(A), -5.0, n1) + linspace(5, max(A)-10.0, n2)

print(listP)

B = ghp.run(RunMCpositive, listP,False)
C = ghp.run(RunMCnegative, listP,False)

k1, k2, k3 = [], [], []
M1, M2, M3 = [], [], []
Nupos, Nuneg = [], []
M1uP, M2uP, M3uP = [], [], []
M1uN, M2uN, M3uN = [], [], []

for item in B:
    """
    k1.append(item[0])
    k2.append(item[1])
    k3.append(item[2])
    M1.append(item[3])
    M2.append(item[4])
    M3.append(item[5])
    """
    if len(item[4]) != 0:
        Nupos.append(item[3][-1])
        M1uP.append( max(item[4]))
        M2uP.append( max(item[5]))

for item in C:
    """
    k1.append(item[0])
    k2.append(item[1])
    k3.append(item[2])
    M1.append(item[3])
    M2.append(item[4])
    M3.append(item[5])
    """
    if len(item[4]) != 0:
        Nuneg.append(item[3][-1])
        M1uN.append( min(item[4]))
        M2uN.append( min(item[5]))
"""
k1 = th.list_to_tree(k1)
k2 = th.list_to_tree(k2)
k3 = th.list_to_tree(k3)
M1 = th.list_to_tree(M1)
M2 = th.list_to_tree(M2)
M3 = th.list_to_tree(M3)
"""
M1u = M1uN + M1uP[::-1] + M1uN[0:1]
M2u = M2uN + M2uP[::-1] + M2uN[0:1]
N = Nuneg + Nupos[::-1] + Nuneg[0:1]
# ---------- end mnm ----------
panel_9 = Panel(mnm.M2u)
image_2 = ImageSampler(
    FilePath="C:\Users\Domen\Desktop\Alpaca MC\diagram N-M.png",
    Filter="Colour",
    Interpolate=True,
    Umax=640,
    Umin=1,
    Vmax=480,
    Vmin=1,
    Wrap=0)

panel_10 = Panel("M-k")  # disabled
panel_11 = Panel("M-k")  # disabled
gh_cpython = GH_CPython(
    data_X=mnm.k2,
    data_Y=mnm.M2,
    name_AxisX="Curvature",
    name_AxisY="Bending Moment |KNm|",
    title=panel_11,
    NameSave=panel_10)  # -> output, pathSave; inputs data_X: list, data_Y: list, name_AxisX: list, name_AxisY: list, legend: list, title: list, NameSave: list; disabled
# ---------- gh_cpython: Python ----------
# -*- coding: utf-8 -*-
""" 
Python Script
Created on  Saturday August 2021 05:11:41 
@author:  Domen 

[desc]
Description of the plugin Here
Write here any thing... 
[/desc]

ARGUMENTS:
----------
<inp> 
    _input :[required] - [type = int] - [default = None] 
    Descripe your input here 
        * bullet point.
        * bullet point
</inp>
<inp>
    Other inputs go here ...
</inp>

RETURN:
----------
    <out>
        output_ : indicate your output description here. \n refers to a new line.
    </out>

"""
import matplotlib.pyplot as plt
import numpy as np
import os

print('getcwd:      ', os.getcwd())
print('__file__:    ', __file__)

pathSave = os.path.join(os.getcwd(), "NameSave"+ ".png")
 
# Data for plotting
t = data_X
s = data_Y



fig, ax = plt.subplots()
for itemX, itemY, Ilegend in zip(t, s, legend):
    ax.plot(itemX, itemY, label ='axis load = ' + str(Ilegend))

ax.set(xlabel=name_AxisX, ylabel=name_AxisY,
       title=title)

ax.legend(loc ="lower right")
ax.grid()

fig.savefig(title +".png")
#plt.savefig(pathSave)
# ---------- end gh_cpython ----------
gh_cpython_2 = GH_CPython(
    data_X=mcm.k2,
    data_Y=mcm.M2,
    name_AxisX="Curvature",
    name_AxisY="Bending Moment |KNm|",
    title="diagram M-k",
    NameSave="diagram M-k")  # -> output, pathSave; inputs data_X: list, data_Y: list, name_AxisX: list, name_AxisY: list, title: list, NameSave: list
# ---------- gh_cpython_2: Python ----------
# -*- coding: utf-8 -*-
""" 
Python Script
Created on  Saturday August 2021 05:11:41 
@author:  Domen 

[desc]
Description of the plugin Here
Write here any thing... 
[/desc]

ARGUMENTS:
----------
<inp> 
    _input :[required] - [type = int] - [default = None] 
    Descripe your input here 
        * bullet point.
        * bullet point
</inp>
<inp>
    Other inputs go here ...
</inp>

RETURN:
----------
    <out>
        output_ : indicate your output description here. \n refers to a new line.
    </out>

"""
import matplotlib.pyplot as plt
import numpy as np
import os

print('getcwd:      ', os.getcwd())
print('__file__:    ', __file__)

pathSave = os.path.join(os.getcwd(), "NameSave"+ ".png")
 
# Data for plotting
t = data_X
s = data_Y


fig, ax = plt.subplots()
ax.plot(t, s)

ax.set(xlabel=name_AxisX, ylabel=name_AxisY,
       title=title)
ax.grid()

fig.savefig(title +".png")
#plt.savefig(pathSave)
# ---------- end gh_cpython_2 ----------
image_3 = ImageSampler(
    FilePath="C:\Users\Domen\Desktop\Alpaca MC\M-k.png",
    Filter="Colour",
    Interpolate=True,
    Umax=640,
    Umin=1,
    Vmax=480,
    Vmin=1,
    Wrap=0)
gh_cpython_3 = GH_CPython(
    data_X=mnm.N,
    data_Y=mnm.M2u,
    name_AxisX="Axial load |KN|",
    name_AxisY="Bending Moment |KNm|",
    title="diagram N-M",
    NameSave="diagram N-M")  # -> output, pathSave; inputs data_X: list, data_Y: list, name_AxisX: list, name_AxisY: list, title: list, NameSave: list; same code as gh_cpython_2
