# Grasshopper definition Section capacity check_Jaimin_Alpaca_Rev01.gh (Grasshopper 1.0.7)

# Format Engineers CAD Information Issue Disclaimer
# 
# Project: PROJECT NAME
# 
# You should use this model for reference purposes only to assist in co-ordinating your work and is supplementary to formally issued drawings. Once the data is introduced into your own CAD or other system Format Engineers Ltd. can take no responsibility for its accuracy.
# 
# The last set of formally issued paper drawings are the contractual documents which represent the current stage of design development. If you have any queries, please contact the project CAD co-ordinator or the CAD Development Team.
# 
# Changes:
# 
# YYYY-MM-DD: Summary of changes
# 
# Usage notes:
# 
# This definition includes a basic implementation of Merbarki's Farthest Point Seeding algorithm (2005), adapted for tracing lines of principal curvature on NURBS surfaces. Requires modified Triangle.NET, if this isn't attached then... good luck! There are currently two main limitations: (a) this implementation measures density in parameter space, and (b) it doesn't include the dynamic refinement of density that Mebarki suggests.
panel = Panel("139.7")

# ---- group: to see the code inside the python component
# CHS Section Capacity
number_slider = Slider(50, range=0..100)
panel_2 = Panel("50")
path = FilePath("C:\Users\jaimi\OneDrive\Desktop\Alpaca4D-development\Github_repo\Alpaca4D\Section_capacity_check_CHS.py")
file = ReadFile(File=path, PerLineParse=False)
python = GhPythonScript(
    Code=file,
    D="139.7",
    T="3.6",
    Fy="355",
    E="200000",
    Ned="-154600",
    Ved="200",
    Medy="0",
    Medz="500",
    Lcr=number_slider,
    Type=Slider(0, range=0..100),
    T_2=number_slider)
panel_3 = Panel(python)

# ----
path_2 = FilePath("C:\Users\jaimi\OneDrive\Desktop\Alpaca4D-development\Github_repo\Alpaca4D\Section_capacity_check_RHS.py")
file_2 = ReadFile(File=path_2, PerLineParse=False)

# ----
# RHS Section Capacity
number_slider_2 = Slider(20, range=0..100)
number_slider_3 = Slider(50, range=0..100)
panel_4 = Panel("20")
rhs_section = GhPythonScript(
    Code=file_2,
    Dy="150",
    Dz="150",
    T=number_slider_2,
    Fy="355",
    E="2.1e05",
    Ned="-154600",
    Vedy="200",
    Vedz="200",
    Medy="0",
    Medz="500",
    Lcry=number_slider_3,
    Lcrz=number_slider_3,
    Type=number_slider_3,
    T_2=number_slider_3)  # -> Out, CombineUtilisation
panel_5 = Panel(rhs_section.CombineUtilisation)
panel_6 = Panel(rhs_section.Out)

python_2 = GhPythonScript(d=panel, t="3.6", fy="355", Ned="154600", Ved="200", Medy="0", Medz="50")  # -> out, combineUtilisation
# ---------- python_2: Python ----------
import Rhino.Geometry as rg
import math

"""
input:
    Diameter
    thickness
    material properties
    gammaM0

output:
    tensionUtilisation
    bendingUtilisation
"""

gammaM0 = 1.0


def classSectionCHS(d,t,fy):
    epsilon = math.sqrt(235/fy)
    
    if d/t <= 50 * math.pow(epsilon, 2):
        classSection = 1
    elif d/t <= 70 * math.pow(epsilon, 2):
        classSection = 2
    elif d/t <= 90 * math.pow(epsilon, 2):
        classSection = 3
    else:
        classSection = 4
    
    return classSection


classSection = classSectionCHS(d,t,fy)


if t == 0 or t == d / 2:
    Area = math.pow(d,2)/4  * math.pi
elif t < d/2 and t >= 0:
    Area = (pow(d,2)-pow((d-2*t),2))/4 * math.pi
else:
    Area = None



# tension check
def tensionCheck(Ned, Area, fy, gammaM0):
    if Ned > 0:
        NplRd = (Area * fy) / gammaM0
        tensionUtilisation = Ned/NplRd
    
    return NplRd, tensionUtilisation

Nrd = tensionCheck(Ned, Area, fy, gammaM0)[0]
# shear Check

def shearCheck(Ved, Area, fy, gammaM0):
    shearArea = 2 * Area / math.pi
    VplRd = (shearArea * (fy/math.sqrt(3)) ) / gammaM0
    shearUtilisation = Ved, VplRd
    
    return VplRd, shearUtilisation

VplRd = shearCheck(Ved, Area, fy, gammaM0)[0]

# shear check
# bending-shear check

if Ved/VplRd < 0.5:
    rho = 0
else:
    rho = math.pow( ((2*Ved / VplRd) -1),2)
fyred = (1-rho)*fy


print("classSection: {}".format(classSection))
print("Ved/VplRd = {}".format(Ved/VplRd))
print("reduced yield strength= {}".format(fyred))


classSection = classSectionCHS(d,t,fy)
if classSection == 1 or classSection == 2:
    Wpl = (math.pow(d,3) - math.pow(d - 2*t,3)) / 6
    MRd = (Wpl * fyred) / gammaM0
elif classSection == 3:
    Wel = math.pi*( math.pow(d,4) - math.pow(d - 2*t,4)) / (32 * d)
    MRd = (Wel * fyred) / gammaM0
else:
    raise ValueError('section in class 4')



# bending-normal force check

n = Ned/Nrd
MnRd = Wpl*fyred*(1-math.pow(n,1.7))


print("Nrd: {} kN".format(round(Nrd/1000)))
print("VplRd: {} kN".format(round(VplRd/1000)))
print("MRd: {} kNm".format(round(MRd/1000000,2)))
print("MnRd: {} kNm".format(round(MnRd/1000000,2)))

bendingUtilisation = Medy/MRd

combineUtilisation = Ned/Nrd + Medy/MnRd + Medz/MnRd
# ---------- end python_2 ----------
panel_7 = Panel(python_2.combineUtilisation)
panel_8 = Panel(python_2.out)
uem = UniaxialElasticMaterialAlpaca4d(E="2.01e11", v="0.30", rho="7850")  # -> out, uniAxialMaterial
# ---------- uem: Python ----------
"""
Create a uniaxial Elastic Material
-
    Args:
        E:
        Eneg:
        eta:
        G:
        v:
        rho:
    Returns:
        uniAxialMaterial:
"""

ghenv.Component.Name = "uniaxial Elastic Material (Alpaca4d)"
ghenv.Component.NickName = 'UEM'
ghenv.Component.Message = "uniaxial Elastic (Alpaca4d)"

import sys
import Rhino.Geometry as rg
import Grasshopper as gh
import copy


## add alpaca install directory to system path

ghcompfolder = gh.Folders.DefaultAssemblyFolder
if ghcompfolder not in sys.path:
    sys.path.append(ghcompfolder)

try:
    from Alpaca4d import alpaca4d as alpaca
except:
    msg = "Cannot import Alpaca4d. Is the Alpaca4d folder available in " + ghcompfolder + "?"
    ghenv.Component.AddRuntimeMessage(gh.Kernel.GH_RuntimeMessageLevel.Error, msg)


checkData = True

if not E:
    checkData = False
    msg = "Input parameter E failed to collect data"
    ghenv.Component.AddRuntimeMessage(gh.Kernel.GH_RuntimeMessageLevel.Warning, msg)

if not G and not v:
    checkData = False
    msg = "Input parameter G or v failed to collect data"
    ghenv.Component.AddRuntimeMessage(gh.Kernel.GH_RuntimeMessageLevel.Warning, msg)

if not rho:
    checkData = False
    msg = "Input parameter rho failed to collect data"
    ghenv.Component.AddRuntimeMessage(gh.Kernel.GH_RuntimeMessageLevel.Warning, msg)



if checkData:
    uniAxialMaterial = alpaca.uniAxialMaterialElastic(name, E, Eneg, eta, G, v, rho)
# ---------- end uem ----------
is = ISectionAlpaca4d(Bsup="150", tsup="20", Binf="150", tinf="20", H="150", tw="20", material=uem.uniAxialMaterial)  # -> Section
# ---------- is: Python ----------
"""
Create a double T Cross Section
-
    Args:
        secName:
        Bsup:
        tsup:
        Binf:
        tinf:
        H:
        tw:
        material:
    Returns:
        Section:
"""
ghenv.Component.Name = "I Section (Alpaca4d)"
ghenv.Component.NickName = 'IS'
ghenv.Component.Message = "I Section (Alpaca4d)"

import sys
import Rhino.Geometry as rg
import Grasshopper as gh
import copy



## add alpaca install directory to system path

ghcompfolder = gh.Folders.DefaultAssemblyFolder
if ghcompfolder not in sys.path:
    sys.path.append(ghcompfolder)

try:
    from Alpaca4d import alpaca4d as alpaca
except:
    msg = "Cannot import Alpaca4d. Is the Alpaca4d folder available in " + ghcompfolder + "?"
    ghenv.Component.AddRuntimeMessage(gh.Kernel.GH_RuntimeMessageLevel.Error, msg)


checkData = True

if not Bsup:
    checkData = False
    msg = "Input parameter Bsup failed to collect data"
    ghenv.Component.AddRuntimeMessage(gh.Kernel.GH_RuntimeMessageLevel.Warning, msg)

if not tsup:
    checkData = False
    msg = "Input parameter tsup failed to collect data"
    ghenv.Component.AddRuntimeMessage(gh.Kernel.GH_RuntimeMessageLevel.Warning, msg)

if not Binf:
    checkData = False
    msg = "Input parameter Binf failed to collect data"
    ghenv.Component.AddRuntimeMessage(gh.Kernel.GH_RuntimeMessageLevel.Warning, msg)

if not tinf:
    checkData = False
    msg = "Input parameter tinf failed to collect data"
    ghenv.Component.AddRuntimeMessage(gh.Kernel.GH_RuntimeMessageLevel.Warning, msg)

if not H:
    checkData = False
    msg = "Input parameter H failed to collect data"
    ghenv.Component.AddRuntimeMessage(gh.Kernel.GH_RuntimeMessageLevel.Warning, msg)

if not tw:
    checkData = False
    msg = "Input parameter tw failed to collect data"
    ghenv.Component.AddRuntimeMessage(gh.Kernel.GH_RuntimeMessageLevel.Warning, msg)

if not material:
    checkData = False
    msg = "Input parameter material failed to collect data"
    ghenv.Component.AddRuntimeMessage(gh.Kernel.GH_RuntimeMessageLevel.Warning, msg)



if checkData:
    Section = alpaca.I_Section(secName, Bsup, tsup, Binf, tinf, H, tw, material)
# ---------- end is ----------
path_3 = FilePath("C:\Users\Marco\Documents\GitHub\Alpaca4d_Development\WIP_Files\forNextRelease\CrossSection_checks\Section_capacity_check_I-section.py")
path_4 = FilePath("C:\Users\Marco\Documents\GitHub\Alpaca4d_Development\WIP_Files\forNextRelease\CrossSection_checks\Section_capacity_check_I-section.py")
number_slider_4 = Slider(50, range=0..100)
number_slider_5 = Slider(50, range=0..100)
file_3 = ReadFile(File=path_3, PerLineParse=False)
file_4 = ReadFile(File=path_4, PerLineParse=False)
# I- Section Capacity
rhs_section_2 = GhPythonScript(
    Section=is,
    Lb="150",
    fy="355",
    E="2.1e05",
    Ned="-154600",
    Vedy="200",
    Vedz="200",
    Medy="0",
    Medz="500",
    Lcry=number_slider_4,
    Lcrz=number_slider_4,
    type="0",
    T=number_slider_4)  # -> out, combineUtilisation
# ---------- rhs_section_2: Python ----------
#section capacity check I-Section

import Rhino.Geometry as rg
import math

"""
input:
    Depth (h)-mm
    top flange width (b_top)-mm
    bottom flange width (b_bottom)-mm
    Web thickness (tw)-mm
    Top Flange thickness (tf_top)-mm
    Bottom flange Thickness (tf_bottom)-mm
    material properties
    gamma_M0

output:
    tensionUtilisation
    bendingUtilisation
"""

gamma_M0 = 1.0
gamma_M1 = 1.0
gamma_M2 = 1.1

upsilon= 0.3
G= E/2*(1+upsilon)
eta = 1.2 if fy<= 460 else 1

h = Section.H
b_top = Section.Bsup
b_bottom = Section.Binf
tw = Section.tw
tf_top = Section.tsup
tf_bottom = Section.tinf


var_set= [h,b_top, b_bottom, tw, tf_top, tf_bottom]

if any(i<=0 for i in var_set):
  raise ValueError('Negative or zero value detected')
elif any (i<=3 for i in var_set) :
    raise ValueError('Thickness is less then 3 mm') 

Area = Section.Area()
#Area = (h*tw) + (b_top-tw)*tf_top + (b_bottom-tw)*tf_bottom
h_web = h-tf_bottom-tf_top #web height excluding flange thickness

A1= b_bottom*tf_bottom ; y1= tf_bottom/2  #bottom flaneg area
A2= (h-tf_bottom-tf_top)*tw ; y2= h/2     #web area
A3= b_top*tf_top ; y3= h/2- tf_top/2      #top flange area

cy_pos = (A1*y1 + A2*y2 + A3*y3)/(A1 + A2 + A3)
cy_neg = h - cy_pos

Iy1= b_bottom*tf_bottom**3/12; Iy2 = tw*(h-tf_bottom-tf_top)**3/12; Iy3 = b_top*tf_top**3/12   
Iy = Iy1 + A1*(cy_pos- y1) + Iy2 + A2*(cy_pos- y2) + Iy3 + A3*(cy_pos- y3)
Iz_web= (h-tf_bottom-tf_top)*tw**3/12
Iz = tf_bottom*b_bottom**3/12 + Iz_web + tf_top*b_top**3/12


alpham = [0.13, 0.21, 0.34, 0.49, 0.76]  #buckling curves
epsilon = math.sqrt(235/fy)


#Shear Area
Av_z = max(h*tw, eta*A2) #web max area
Av_y = A1 + A3   #flange area only

[Rx_0, Ry_0, Rz_0,Mxx_0, Myy_0, Rx_1, Ry_1, Rz_1,Mxx_1, Myy_1]= [1,1,1,1,1,1,1,1,1,1]

#Torsional property and checks
if T!=0: 
    h_web_T= h_web + (tf_bottom + tf_top)/2
    #h0 =2*((dy-t) + (dz-t))
    #Ah = (dy-t)*(dz-t)
    J= (b_bottom*tf_bottom**3 + b_top*tf_top**3 + h_web_T*tw**3)/3  #torsional constant
    Cw= h_web_T**2*tf_bottom*tf_top*b_bottom**3*b_top**3/(12*(tf_top*b_top**3 + tf_bottom*b_bottom**3))   #warping constant

    K_t = Lb*math.sqrt(G*J/(E*Cw))

    if [Mxx_0, Myy_0, Mxx_1, Myy_1] == [0,0,0,0] : #Mxx, Myy,MZZ end moment restrain; Rx,Ry,Rz = end translation restrain
        alpha_T = 3.7 ; beta_T = 1.08
    elif [Mxx_0, Myy_0, Mxx_1, Myy_1] == [1,1,1,1] :
        alpha_T = 6.9 ; beta_T = 1.14
    elif [Rx_0, Ry_0, Rz_0, Rx_1, Ry_1, Rz_1] == [0,0,0,1,1,1] or [Rx_0, Ry_0, Rz_0, Rx_1, Ry_1, Rz_1] == [1,1,1,0,0,0]:
        alpha_T = 2.7 ; beta_T = 1.11

    chi_torsion = 1/(beta_T + (alpha_T/K_t)**2)
    T_warp = T*(1-chi_torsion)
    T_vernant = T*chi_torsion
    
    #Trd= Cw*(fy/math.math.sqrt(3))/gamma_M0


var_classsection = [h,b_top, b_bottom, tw, tf_top, tf_bottom,epsilon]

def classSection_I_Compression(var_set):  #class section for compression in Y
    c_web= h-tf_top- tf_bottom
    c_flange_top = (tf_top-tw)/2
    c_flange_bottom = (tf_bottom-tw)/2

    if (b_bottom != b_top) or (tf_top != tf_bottom):  #check if unsymmetrical I-section, considering elasric capacity always
        
        if (c_web/tw <= 42*epsilon) and (i<=14*epsilon for i in [c_flange_top/tf_top, c_flange_bottom/tf_bottom]) :
            classSection = 3
        else:
            raise ValueError('section unsymmetrical and in class 4')
    else:
        if c_web/tw <= 33 * epsilon and (i<=9*epsilon for i in [c_flange_top/tf_top,c_flange_bottom/tf_bottom]):
            classSection = 1
        elif c_web/tw <= 38 * epsilon and (i<=10*epsilon for i in [c_flange_top/tf_top,c_flange_bottom/tf_bottom]) :
            classSection = 2
        elif c_web/tw <= 42 * epsilon and (i<=14*epsilon for i in [c_flange_top/tf_top,c_flange_bottom/tf_bottom]):
            classSection = 3
        else:
            raise ValueError('section in class 4')
    
    return classSection

def classSection_I_Moment(var_set):  #class section for compression in Z
    c_web= h-tf_top- tf_bottom
    c_flange_top = (tf_top-tw)/2
    c_flange_bottom = (tf_bottom-tw)/2

    if b_bottom != b_top or tf_top != tf_bottom:  #check if unsymmetrical I-section, considering elastic capacity always, check in with marco
        if c_web/tw <= 124*epsilon and (i<=14*epsilon for i in [c_flange_top/tf_top,c_flange_bottom/tf_bottom]):
            classSection=3
        else: 
            raise ValueError('section unsymmetrical and in class 4')

    else:
        if c_web/tw <= 72 * epsilon and (i<=9*epsilon for i in [c_flange_top/tf_top,c_flange_bottom/tf_bottom]):
            classSection = 1
        elif c_web/tw <= 83 * epsilon and (i<=10*epsilon for i in [c_flange_top/tf_top,c_flange_bottom/tf_bottom]):
         classSection = 2
        elif c_web/tw <= 124 * epsilon and (i<=14*epsilon for i in [c_flange_top/tf_top,c_flange_bottom/tf_bottom]):
            classSection = 3
        else:
            raise ValueError('section in class 4')
    return classSection

def classSection_I_Compression_Moment(var_set):  #class section for compression in Z
    c_web= h-tf_top- tf_bottom
    c_flange_top = (tf_top-tw)/2
    c_flange_bottom = (tf_bottom-tw)/2

    alpha_local_web= 0.5*(1+ abs(Ned)/(fy*c_web*tw))
    alpha_local_flange_top= 0.5*(1+ abs(Ned)/(fy*c_flange_top*tf_top))    # check if c*tf is correct for area
    alpha_local_flange_bottom=0.5*(1+ abs(Ned)/(fy*c_flange_bottom*tf_bottom))

    psi_web= 2*Ned/(c_web*tw*fy) - 1
    psi_flange_top= 2*Ned/(c_flange_top*tf_top*fy) - 1
    psi_flange_bottom= 2*Ned/(c_flange_bottom*tf_bottom*fy) - 1

    if psi_flange_top == 1 :
        k_sigma_top= 0.43
    elif 0< psi_flange_top < 1 :
        k_sigma_top = 0.578/(psi_flange_top + 0.34)
    elif psi_flange_top == 0:
        k_sigma_top= 1.7
    elif -1< psi_flange_top< 0 :
        k_sigma_top = 1.7 - 5*psi_flange_top + 17.1*psi_flange_top**2
    elif psi_flange_top == -1 :
        k_sigma_top= 23.8
    

    if psi_flange_bottom == 1 :
        k_sigma_bottom= 0.43
    elif 0< psi_flange_bottom < 1 :
        k_sigma_bottom = 0.578/(psi_flange_bottom + 0.34)
    elif psi_flange_bottom == 0 :
        k_sigma_bottom= 1.7
    elif -1< psi_flange_bottom< 0 :
        k_sigma_bottom = 1.7 - 5*psi_flange_bottom + 17.1*psi_flange_bottom**2
    elif psi_flange_bottom == -1 :
        k_sigma_bottom= 23.8
    

    if alpha_local_web >0.5:
        class_1_limit= 396*epsilon/(13*alpha_local_web - 1)
        class_2_limit= 456*epsilon/(13*alpha_local_web - 1)
    else :
        class_1_limit= 36*epsilon/alpha_local_web
        class_2_limit= 41.5*epsilon/alpha_local_web

    if psi_web > -1:
        class_3_limit = 42*epsilon/(0.67 + 0.33*psi_web)
    else :
        class_3_limit= 62*epsilon*(1-psi_web)*math.sqrt(abs(psi_web))



    if b_bottom != b_top or tf_top != tf_bottom:  #check if unsymmetrical I-section, considering elasric capacity always
        if c_web/tw <= class_3_limit and c_flange_top/tf_top<= 21*epsilon*math.math.sqrt(k_sigma_top) and c_flange_bottom/tf_bottom<=21*epsilon*math.math.sqrt(k_sigma_bottom):
            classSection = 3
        else: 
           raise ValueError('section Unsymmetrical and in class 4') 
    else:
        if c_web/tw <= class_1_limit and c_flange_top/tf_top<=9*epsilon/alpha_local_flange_top and c_flange_bottom/tf_bottom<=9*epsilon/alpha_local_flange_bottom  :
            classSection = 1
        elif c_web/tw <= class_2_limit and c_flange_top/tf_top<=10*epsilon/alpha_local_flange_top and c_flange_bottom/tf_bottom<=10*epsilon/alpha_local_flange_bottom :
            classSection = 2
        elif c_web/tw <= class_3_limit and c_flange_top/tf_top<= 21*epsilon*math.math.sqrt(k_sigma_top) and c_flange_bottom/tf_bottom<=21*epsilon*math.math.sqrt(k_sigma_bottom) :
            classSection = 3
        else:
            raise ValueError('section in class 4')
    return classSection


if Medy/Ned + Medz/Ned <= 0.05: # if moment arm is 0.05 of the section capacity, do check this value 
    classSection= classSection_I_Compression(var_set)
elif Ned/Medy + Ned/Medz <= 0.05 : # have to check this
    classSection = classSection_I_Moment(var_set)
else:
    classSection = classSection_I_Compression_Moment(var_set)





# shear Check
var_shear= [Vedy,Vedz, Av_y,Av_z, fy, gamma_M0, T] 
def shearCheck(var_shear):
    if (h_web/tw > 72*epsilon/eta) :  #only applies for unstiffened webs, have to make an boolean toggle for this
        sigma_E = math.pi**2*E*tw**2/(12*(1-upsilon**2)*h_web**2)     #EN 1993-1-5 , A.1
        k_tau_st = max(9*(h_web/Lb)**2*math.pow(math.pow((Iz_web/tw**3*h_web), 3),1/4) , 2.1*math.pow(Iz_web/h_web,1/3)/tw, 1/3)    #Lb= a EN 1993-1-5 , A.3
        k_tau = 5.34 + 4*(h_web/Lb)**2 + k_tau_st # if a/h_web <=1 , else k_tau = 4 + 5.34*(h_web/Lb)**2 + k_tau_st - ignore for web without stiffner only
        lamda_w = 0.76*math.sqrt(fy/(k_tau*sigma_E))
        if lamda_w < 0.83/eta:   #1993-1-5 , 5.2
            chi_w = eta  
        elif 0.83/eta <= lamda_w < 1.08 :
            chi_w = 0.83/lamda_w
        else:
            chi_w = 1.37/(0.7 + lamda_w)
        
        VplRdy = chi_w*fy*h_web*tw/(math.sqrt(3)*gamma_M1)
    else: 
        VplRdy = (Av_y * (fy/math.sqrt(3)) )/gamma_M0
    
    VplRdz = (Av_z * (fy/math.sqrt(3)) ) / gamma_M0

    if T !=0 :
        tau_ed_web = T_vernant/tw  #shear stress due to torsion, where T is saint venant torsion
        tau_ed_flange = T_vernant/min(tf_bottom,tf_top)
    VplRdy = (1-(tau_ed_web/(fy/math.sqrt(3)/ gamma_M0)))*VplRdy
    VplRdz = (1-(tau_ed_flange/(fy/math.sqrt(3)/ gamma_M0)))*VplRdz
    shearUtilisation_y = Vedy/VplRdy # for combined shear in both direction
    shearUtilisation_z = Vedz/VplRdz
    
    return VplRdy, VplRdz, shearUtilisation_y, shearUtilisation_z

shearUtilisation_y= shearCheck(var_shear)[2]
shearUtilisation_z= shearCheck(var_shear)[3]


if shearUtilisation_y < 0.5 and shearUtilisation_z < 0.5:
    rho = 0
else:
    rho =  ((2*shearUtilisation) -1)**2 # does this make sense? (shear Utilization)
fy = (1-rho)*fy


# bending check
var_moment= [h,b_top, b_bottom, tw, tf_top, tf_bottom]

def Moment_check(var_set) :
    #section modulus check
    if classSection == 3:
        Wly = Iy/max(cy_pos, cy_neg) #elastic modulus y-y
        Wlz = Iz/max(b_top, b_bottom) #elastic modulus z-z
    elif classSection == 1 or 2 :
        Wly= (h-cy_neg-tf_bottom)**2*tw/2 + b_bottom*tf_bottom*(cy_pos-(tf_bottom/2))  #plastic modulus y-y
        Wlz = (A3*b_top+ A1*b_bottom)/4    #plastic modulus z-z
    else:
        raise valueerror('section in Class4, too slender')

    MRdy = Wly*fy/gamma_M0 
    MRdz = Wlz*fy/gamma_M0

    # 6.2.9 bending + axial
    Ncpr= (Area * fy) / gamma_M0 #compression plastic resistance

    if Ned > 0.25*Ncpr or Ned > 0.5*h_web*tw*fy/gamma_M0:
        n = Ned/Ncpr
        a= min((area - A1- A3)/area, 0.5)
        MRdy = min(MRdy*(1-n/(1- 0.5*a)), MRdy)
    elif Ned > h_web*tw*fy/gamma_M0:
        if n>a:
            MRdz = MRdz*(1- ((n-a)/(1-a))**2)
    
    Ma= 100 #bending moment at quater point have to get Ma,Mb,Mc value from opensees analysis
    Mb = 100 #bending moment at mid point
    Mc = 100 #bending moment at end point
    M_max = 100 #maximum bending moment on the member
    Cb = 12.5*M_max/(2.5*M_max + 3*Ma + 4*Mb + 3*Mc)  # shape factor based on bending diagram (AISC), only applies for moment in Y-Y

    #EN-1993-1-1 6.3.2.2
    k=1 ; k_w = 1  # end rotation factor ; end warping factor, have to include this going forward
    L_ltb = Lb ; k_ltb = 1 #length of unbraced member  # effective length factor for lateral torsional buckling, overriding L_ltb
    L_cr_ltb = L_ltb*k_ltb # effective critical length


    M_cr = Cb*math.pi**2*E*Iz*(math.sqrt((k*Cw/(k_w*Iz)) + (L_cr_ltb**2*G*J/(math.pi**2*E*Iz))))/L_cr_ltb**2  # , M_cr critical Bending moment
    Lamda_lt = math.sqrt(Wly*fy/M_cr)
    beta_lt = 0.75 #recommended value
    Lamda_lt_0 = 0.4 # recommended value

    if type==0 :
        if h/min(b_bottom,b_top) <= 2: #hot rolled sections
            alpha_lt = alpham[1]
        else:
            alpha_lt = alpham[2]
    if type== 1 :
        if h/min(b_bottom,b_top) <= 2:    #cold form section
            alpha_lt = alpham[3]
        else:
            alpha_lt = alpham[4]

    phi_lt = 0.5*(1 + alpha_lt*(Lamda_lt - Lamda_lt_0) + beta_lt*Lamda_lt**2)
    chi_lt = min(1/(phi_lt + math.sqrt(phi_lt**2 - beta_lt*Lamda_lt**2)), 1, 1/(Lamda_lt**2))

    if chi_lt <1:
         MRdy =chi_lt*MRdy

    return MRdy, MRdz 

MRdy = Moment_check(var_moment)[0]
MRdz = Moment_check(var_moment)[1]


var_Axial = [Ned,Area,fy,Lb, Lb,gamma_M0, type]
# compression Check

def Axial_check(var_Axial):

    NplRd = (Area * fy) / gamma_M0
    if Ned <=0 : # - indicates member in tension
        Nrd = NplRd    #require sign to be assigned to tesion force
    else:
        Ncpl =  NplRd
        k_cr_y = 1 ; k_cr_z = 1 ; Lcry= k_cr_y*Lb ; Lcrz= k_cr_z*Lb # k_cr is effective length factor in respective direction

        Ncry = math.pi**2*E*Iy/Lcry**2   #euler critical buckling y direction
        Ncrz = math.pi**2*E*Iz/Lcrz**2   #euler critical buckling z direction
        Lamda_y = math.math.sqrt((Area*fy)/Ncry) ; Lamda_z = math.math.sqrt((Area*fy)/Ncrz) #slenderness ratio
        if type == 0 : #0= hot rolled, 1= cold formed
            if h/min(b_bottom, b_top) >1.2:
                if min(tf_bottom, tf_top) <= 40: #mm:
                    if fy>420: #Mpa:
                        alpha_y = alpham[0] 
                        alpha_z = alpham[0]
                    else:
                        alpha_y = alpham[1] 
                        alpha_z = alpham[2]
                elif 40< min(tf_bottom, tf_top) <= 100 : #mm
                    if fy>420: #Mpa:
                        alpha_y = alpham[1] 
                        alpha_z = alpham[1]
                    else:
                        alpha_y = alpham[2] 
                        alpha_z = alpham[3]
                else:
                    raise ValueError('flange thickness out of limits')
            
            else:
                if min(tf_bottom, tf_top) <= 100 :  #mm:
                    if fy>420: #Mpa:
                        alpha_y = alpham[1] 
                        alpha_z = alpham[1]
                    else:
                        alpha_y = alpham[2] 
                        alpha_z = alpham[3]
                elif  min(tf_bottom, tf_top) >100 : #mm
                    if fy>420: #Mpa:
                        alpha_y = alpham[3] 
                        alpha_z = alpham[3]
                    else:
                        alpha_y = alpham[4] 
                        alpha_z = alpham[4]
                else:
                    raise ValueError('flange thickness out of limits')    
        elif type == 1 :
            if min(tf_bottom, tf_top) <= 40 : #mm:
                alpha_y = alpham[2] 
                alpha_z = alpham[3]
            else:
                alpha_y = alpham[3] 
                alpha_z = alpham[4]

        phi_y= 0.5*(1 + alpha_y*(Lamda_y - 0.2) + Lamda_y**2) 
        phi_z= 0.5*(1 + alpha_z*(Lamda_z - 0.2) + Lamda_z**2)
        chi_yy = 1/(phi_y+ math.sqrt(phi_yy**2 - Lamda_y**2))
        chi_zz = 1/(phi_z+ math.sqrt(phi_zz**2 - Lamda_z**2))

        Nbrd_y= chi_yy*Ncpl ; Nbrd_z= chi_zz*Ncpl
        Nbrd = min(Nbrd_y, Nbrd_z)
        Nrd= min(Ncpl, Nbrd)
    return Nrd

Nrd = Axial_check(var_Axial)

# need to add second order effecrs for bending + axial



# bending-cpmpression reduction in bending capacity due to compression probably can igonore it, have to confirm with marco

#n = Ned/Nrd
#MnRd = Wpl*fyred*(1-math.pow(n,1.7))

if Ned>0:
    combine_Utilisation = abs(Ned)/Nrd
elif Ned <= 0:
    combine_Utilisation = abs(Ned)/Nrd + Medy/MRdy + Medz/MRdz
print(combine_Utilisation)

shearUtilisation = max(shearUtilisation_y ,shearUtilisation_z)

print("classSection: {}".format(classSection))
print("Ned/Nrd = {}".format(Ned/Nrd))
print("reduced yield strength= {}".format(fy))

print("Nrd: {} kN".format(round(Nrd/1000)))
print("VplRd: {} kN".format(round(shearUtilisation/1000)))
print("Mrdy: {} kNm".format(round(MRdy/1000000,2)))
print("Mrdz: {} kNm".format(round(MRdz/1000000,2)))
# ---------- end rhs_section_2 ----------
# I- Section Capacity
rhs_section_3 = GhPythonScript(
    Code=file_4,
    H="150",
    B_top="150",
    B_bottom="150",
    Lb="150",
    Tw="20",
    Tf_top="20",
    Tf_bottom="20",
    Fy="355",
    E="2.1e05",
    Ned="-154600",
    Vedy="200",
    Vedz="200",
    Medy="0",
    Medz="500",
    Lcry=number_slider_5,
    Lcrz=number_slider_5,
    Type="0",
    T=number_slider_5)  # -> Out, CombineUtilisation
panel_9 = Panel(rhs_section_2.out)
panel_10 = Panel(rhs_section_2.combineUtilisation)
panel_11 = Panel(rhs_section_3.Out)
panel_12 = Panel(rhs_section_3.CombineUtilisation)

# ---- group: no code inside the component
# File Path
path_5 = FilePath("C:\Users\jaimi\OneDrive\Desktop\Alpaca4D-development\Github_repo\Alpaca4D\Section_capacity_check_CHS.py")
number_slider_6 = Slider(50, range=0..100)
# right click on component and
# select  "show code input parameter"
# and "input is path" should have a blue color
panel_14 = Panel("139.7")

# ----
file_5 = ReadFile(File=path_5, PerLineParse=False)

# ---- group: no code inside the component (continued)
python_3 = GhPythonScript(
    Code=file_5,
    D=panel_14,
    T="3.6",
    Fy="355",
    E="200000",
    Ned="-154600",
    Ved="200",
    Medy="0",
    Medz="500",
    Lcr=number_slider_6,
    Type=Slider(0, range=0..100),
    T_2=number_slider_6)  # -> Out, CombineUtilisation
panel_15 = Panel(python_3.CombineUtilisation)
panel_16 = Panel(python_3.Out)
