# Grasshopper definition Section capacity check_Jaimin_Alpaca_Rev01_2.gh (Grasshopper 1.0.7)

# Format Engineers CAD Information Issue Disclaimer
# 
# Project: PROJECT NAME
# 
# You should use this model for reference purposes only to assist in co-ordinating your work and is supplementary to formally issued drawings. Once the data is introduced into your own CAD or other system Format Engineers Ltd. can take no responsibility for its accuracy.
# 
# The last set of formally issued paper drawings are the contractual documents which represent the current stage of design development. If you have any queries, please contact the project CAD co-ordinator or the CAD Development Team.
# 
# Changes:
# 
# YYYY-MM-DD: Summary of changes
# 
# Usage notes:
# 
# This definition includes a basic implementation of Merbarki's Farthest Point Seeding algorithm (2005), adapted for tracing lines of principal curvature on NURBS surfaces. Requires modified Triangle.NET, if this isn't attached then... good luck! There are currently two main limitations: (a) this implementation measures density in parameter space, and (b) it doesn't include the dynamic refinement of density that Mebarki suggests.
panel = Panel("139.7")

# ---- group: to see the code inside the python component
# CHS Section Capacity
number_slider = Slider(50, range=0..100)
panel_2 = Panel("50")
path = FilePath("C:\Users\jaimi\OneDrive\Desktop\Alpaca4D-development\Github_repo\Alpaca4D\Section_capacity_check_CHS.py")
file = ReadFile(File=path, PerLineParse=False)
python = GhPythonScript(
    Code=file,
    D="139.7",
    T="3.6",
    Fy="355",
    E="200000",
    Ned="-154600",
    Ved="200",
    Medy="0",
    Medz="500",
    Lcr=number_slider,
    Type=Slider(0, range=0..100),
    T_2=number_slider)
panel_3 = Panel(python)

# ----
path_2 = FilePath("C:\Users\jaimi\OneDrive\Desktop\Alpaca4D-development\Github_repo\Alpaca4D\Section_capacity_check_RHS.py")
file_2 = ReadFile(File=path_2, PerLineParse=False)

# ----
# RHS Section Capacity
number_slider_2 = Slider(20, range=0..100)
number_slider_3 = Slider(50, range=0..100)
panel_4 = Panel("20")
rhs_section = GhPythonScript(
    Code=file_2,
    Dy="150",
    Dz="150",
    T=number_slider_2,
    Fy="355",
    E="2.1e05",
    Ned="-154600",
    Vedy="200",
    Vedz="200",
    Medy="0",
    Medz="500",
    Lcry=number_slider_3,
    Lcrz=number_slider_3,
    Type=number_slider_3,
    T_2=number_slider_3)  # -> Out, CombineUtilisation
panel_5 = Panel(rhs_section.CombineUtilisation)
panel_6 = Panel(rhs_section.Out)

python_2 = GhPythonScript(d=panel, t="3.6", fy="355", Ned="154600", Ved="200", Medy="0", Medz="50")  # -> out, combineUtilisation
# ---------- python_2: Python ----------
import Rhino.Geometry as rg
import math

"""
input:
    Diameter
    thickness
    material properties
    gammaM0

output:
    tensionUtilisation
    bendingUtilisation
"""

gammaM0 = 1.0


def classSectionCHS(d,t,fy):
    epsilon = math.sqrt(235/fy)
    
    if d/t <= 50 * math.pow(epsilon, 2):
        classSection = 1
    elif d/t <= 70 * math.pow(epsilon, 2):
        classSection = 2
    elif d/t <= 90 * math.pow(epsilon, 2):
        classSection = 3
    else:
        classSection = 4
    
    return classSection


classSection = classSectionCHS(d,t,fy)


if t == 0 or t == d / 2:
    Area = math.pow(d,2)/4  * math.pi
elif t < d/2 and t >= 0:
    Area = (pow(d,2)-pow((d-2*t),2))/4 * math.pi
else:
    Area = None



# tension check
def tensionCheck(Ned, Area, fy, gammaM0):
    if Ned > 0:
        NplRd = (Area * fy) / gammaM0
        tensionUtilisation = Ned/NplRd
    
    return NplRd, tensionUtilisation

Nrd = tensionCheck(Ned, Area, fy, gammaM0)[0]
# shear Check

def shearCheck(Ved, Area, fy, gammaM0):
    shearArea = 2 * Area / math.pi
    VplRd = (shearArea * (fy/math.sqrt(3)) ) / gammaM0
    shearUtilisation = Ved, VplRd
    
    return VplRd, shearUtilisation

VplRd = shearCheck(Ved, Area, fy, gammaM0)[0]

# shear check
# bending-shear check

if Ved/VplRd < 0.5:
    rho = 0
else:
    rho = math.pow( ((2*Ved / VplRd) -1),2)
fyred = (1-rho)*fy


print("classSection: {}".format(classSection))
print("Ved/VplRd = {}".format(Ved/VplRd))
print("reduced yield strength= {}".format(fyred))


classSection = classSectionCHS(d,t,fy)
if classSection == 1 or classSection == 2:
    Wpl = (math.pow(d,3) - math.pow(d - 2*t,3)) / 6
    MRd = (Wpl * fyred) / gammaM0
elif classSection == 3:
    Wel = math.pi*( math.pow(d,4) - math.pow(d - 2*t,4)) / (32 * d)
    MRd = (Wel * fyred) / gammaM0
else:
    raise ValueError('section in class 4')



# bending-normal force check

n = Ned/Nrd
MnRd = Wpl*fyred*(1-math.pow(n,1.7))


print("Nrd: {} kN".format(round(Nrd/1000)))
print("VplRd: {} kN".format(round(VplRd/1000)))
print("MRd: {} kNm".format(round(MRd/1000000,2)))
print("MnRd: {} kNm".format(round(MnRd/1000000,2)))

bendingUtilisation = Medy/MRd

combineUtilisation = Ned/Nrd + Medy/MnRd + Medz/MnRd
# ---------- end python_2 ----------
panel_7 = Panel(python_2.combineUtilisation)
panel_8 = Panel(python_2.out)
dts = DoubleTSectionAlpaca4d()  # -> Section
# ---------- dts: Python ----------
"""
Create a double T Cross Section
-
    Args:
        secName:
        Bsup:
        tsup:
        Binf:
        tinf:
        H:
        tw:
        material:
    Returns:
        Section:
"""
ghenv.Component.Name = "doubleT Section (Alpaca4d)"
ghenv.Component.NickName = 'DTS'
ghenv.Component.Message = "doubleT Section (Alpaca4d)"

import sys
import Rhino.Geometry as rg
import Grasshopper as gh
import copy



## add alpaca install directory to system path

ghcompfolder = gh.Folders.DefaultAssemblyFolder
if ghcompfolder not in sys.path:
    sys.path.append(ghcompfolder)

try:
    from Alpaca4d import alpaca4d as alpaca
except:
    msg = "Cannot import Alpaca4d. Is the Alpaca4d folder available in " + ghcompfolder + "?"
    ghenv.Component.AddRuntimeMessage(gh.Kernel.GH_RuntimeMessageLevel.Error, msg)


checkData = True

if not Bsup:
    checkData = False
    msg = "Input parameter Bsup failed to collect data"
    ghenv.Component.AddRuntimeMessage(gh.Kernel.GH_RuntimeMessageLevel.Warning, msg)

if not tsup:
    checkData = False
    msg = "Input parameter tsup failed to collect data"
    ghenv.Component.AddRuntimeMessage(gh.Kernel.GH_RuntimeMessageLevel.Warning, msg)

if not Binf:
    checkData = False
    msg = "Input parameter Binf failed to collect data"
    ghenv.Component.AddRuntimeMessage(gh.Kernel.GH_RuntimeMessageLevel.Warning, msg)

if not tinf:
    checkData = False
    msg = "Input parameter tinf failed to collect data"
    ghenv.Component.AddRuntimeMessage(gh.Kernel.GH_RuntimeMessageLevel.Warning, msg)

if not H:
    checkData = False
    msg = "Input parameter H failed to collect data"
    ghenv.Component.AddRuntimeMessage(gh.Kernel.GH_RuntimeMessageLevel.Warning, msg)

if not tw:
    checkData = False
    msg = "Input parameter tw failed to collect data"
    ghenv.Component.AddRuntimeMessage(gh.Kernel.GH_RuntimeMessageLevel.Warning, msg)

if not material:
    checkData = False
    msg = "Input parameter material failed to collect data"
    ghenv.Component.AddRuntimeMessage(gh.Kernel.GH_RuntimeMessageLevel.Warning, msg)



if checkData:
    dTCS = alpaca.doubleTCS(Bsup, tsup, Binf, tinf, H, tw, material)
    Section = alpaca.ElasticSection(secName, dTCS.Area(), dTCS.Izz(), dTCS.Iyy(), dTCS.J(), dTCS.alphaY(), dTCS.alphaZ(), dTCS.material)
    Section.crv = dTCS.crv
    Section.sectionBrep = dTCS.sectionBrep
    
    a = Section.crv
# ---------- end dts ----------

# ----
# I- Section Capacity
path_3 = FilePath("C:\Users\jaimi\OneDrive\Desktop\Alpaca4D-development\Github_repo\Alpaca4D\Section_capacity_check_RHS.py")
file_3 = ReadFile(File=path_3, PerLineParse=False)
number_slider_4 = Slider(50, range=0..100)
rhs_section_2 = GhPythonScript(
    Code=file_3,
    H="150",
    B_top="150",
    B_bottom="150",
    Lb="20",
    Tw=Slider(20, range=0..100),
    Tf_top="15",
    Fy="355",
    E="2.1e05",
    Ned="-154600",
    Vedy="200",
    Vedz="200",
    Medy="0",
    Medz="500",
    Lcry=number_slider_4,
    Lcrz=number_slider_4,
    Type=number_slider_4,
    T=number_slider_4)  # -> Out, CombineUtilisation
panel_9 = Panel(rhs_section_2.CombineUtilisation)
panel_10 = Panel(rhs_section_2.Out)

# ---- group: no code inside the component
# File Path
path_4 = FilePath("C:\Users\jaimi\OneDrive\Desktop\Alpaca4D-development\Github_repo\Alpaca4D\Section_capacity_check_CHS.py")
number_slider_5 = Slider(50, range=0..100)
# right click on component and
# select  "show code input parameter"
# and "input is path" should have a blue color
panel_12 = Panel("139.7")

# ----
file_4 = ReadFile(File=path_4, PerLineParse=False)

# ---- group: no code inside the component (continued)
python_3 = GhPythonScript(
    Code=file_4,
    D=panel_12,
    T="3.6",
    Fy="355",
    E="200000",
    Ned="-154600",
    Ved="200",
    Medy="0",
    Medz="500",
    Lcr=number_slider_5,
    Type=Slider(0, range=0..100),
    T_2=number_slider_5)  # -> Out, CombineUtilisation
panel_13 = Panel(python_3.CombineUtilisation)
panel_14 = Panel(python_3.Out)
