# Grasshopper definition CrossSectionCheck_Frame.gh (Grasshopper 1.0.7)

# Format Engineers CAD Information Issue Disclaimer
# 
# Project: PROJECT NAME
# 
# You should use this model for reference purposes only to assist in co-ordinating your work and is supplementary to formally issued drawings. Once the data is introduced into your own CAD or other system Format Engineers Ltd. can take no responsibility for its accuracy.
# 
# The last set of formally issued paper drawings are the contractual documents which represent the current stage of design development. If you have any queries, please contact the project CAD co-ordinator or the CAD Development Team.
# 
# Changes:
# 
# YYYY-MM-DD: Summary of changes
# 
# Usage notes:
# 
# This definition includes a basic implementation of Merbarki's Farthest Point Seeding algorithm (2005), adapted for tracing lines of principal curvature on NURBS surfaces. Requires modified Triangle.NET, if this isn't attached then... good luck! There are currently two main limitations: (a) this implementation measures density in parameter space, and (b) it doesn't include the dynamic refinement of density that Mebarki suggests.
crv = Curve([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])
graft = GraftTree(Tree=crv, IncludeEmptyLists=True, IncludeNullItems=True)
uem = UniaxialElasticMaterialAlpaca4d(E="2.01e11", v="0.30", rho="7850")  # -> out, uniAxialMaterial
# ---------- uem: Python ----------
"""
Create a uniaxial Elastic Material
-
    Args:
        E:
        Eneg:
        eta:
        G:
        v:
        rho:
    Returns:
        uniAxialMaterial:
"""

ghenv.Component.Name = "uniaxial Elastic Material (Alpaca4d)"
ghenv.Component.NickName = 'UEM'
ghenv.Component.Message = "uniaxial Elastic (Alpaca4d)"

import sys
import Rhino.Geometry as rg
import Grasshopper as gh
import copy


## add alpaca install directory to system path

ghcompfolder = gh.Folders.DefaultAssemblyFolder
if ghcompfolder not in sys.path:
    sys.path.append(ghcompfolder)

try:
    from Alpaca4d import alpaca4d as alpaca
except:
    msg = "Cannot import Alpaca4d. Is the Alpaca4d folder available in " + ghcompfolder + "?"
    ghenv.Component.AddRuntimeMessage(gh.Kernel.GH_RuntimeMessageLevel.Error, msg)


checkData = True

if not E:
    checkData = False
    msg = "Input parameter E failed to collect data"
    ghenv.Component.AddRuntimeMessage(gh.Kernel.GH_RuntimeMessageLevel.Warning, msg)

if not G and not v:
    checkData = False
    msg = "Input parameter G or v failed to collect data"
    ghenv.Component.AddRuntimeMessage(gh.Kernel.GH_RuntimeMessageLevel.Warning, msg)

if not rho:
    checkData = False
    msg = "Input parameter rho failed to collect data"
    ghenv.Component.AddRuntimeMessage(gh.Kernel.GH_RuntimeMessageLevel.Warning, msg)



if checkData:
    uniAxialMaterial = alpaca.uniAxialMaterialElastic(name, E, Eneg, eta, G, v, rho)
# ---------- end uem ----------
divide = DivideCurve(Curve=graft, Count="20", Kinks=False)  # -> Points, Tangents, Parameters
shatter = Shatter(Curve=graft, Parameters=divide.Parameters)
is = ISectionAlpaca4d(Bsup="0.150", tsup="0.05", Binf="0.150", tinf="0.05", H="0.300", tw="0.05", material=uem.uniAxialMaterial)  # -> Section
# ---------- is: Python ----------
"""
Create a double T Cross Section
-
    Args:
        secName:
        Bsup:
        tsup:
        Binf:
        tinf:
        H:
        tw:
        material:
    Returns:
        Section:
"""
ghenv.Component.Name = "I Section (Alpaca4d)"
ghenv.Component.NickName = 'IS'
ghenv.Component.Message = "I Section (Alpaca4d)"

import sys
import Rhino.Geometry as rg
import Grasshopper as gh
import copy



## add alpaca install directory to system path

ghcompfolder = gh.Folders.DefaultAssemblyFolder
if ghcompfolder not in sys.path:
    sys.path.append(ghcompfolder)

try:
    from Alpaca4d import alpaca4d as alpaca
except:
    msg = "Cannot import Alpaca4d. Is the Alpaca4d folder available in " + ghcompfolder + "?"
    ghenv.Component.AddRuntimeMessage(gh.Kernel.GH_RuntimeMessageLevel.Error, msg)


checkData = True

if not Bsup:
    checkData = False
    msg = "Input parameter Bsup failed to collect data"
    ghenv.Component.AddRuntimeMessage(gh.Kernel.GH_RuntimeMessageLevel.Warning, msg)

if not tsup:
    checkData = False
    msg = "Input parameter tsup failed to collect data"
    ghenv.Component.AddRuntimeMessage(gh.Kernel.GH_RuntimeMessageLevel.Warning, msg)

if not Binf:
    checkData = False
    msg = "Input parameter Binf failed to collect data"
    ghenv.Component.AddRuntimeMessage(gh.Kernel.GH_RuntimeMessageLevel.Warning, msg)

if not tinf:
    checkData = False
    msg = "Input parameter tinf failed to collect data"
    ghenv.Component.AddRuntimeMessage(gh.Kernel.GH_RuntimeMessageLevel.Warning, msg)

if not H:
    checkData = False
    msg = "Input parameter H failed to collect data"
    ghenv.Component.AddRuntimeMessage(gh.Kernel.GH_RuntimeMessageLevel.Warning, msg)

if not tw:
    checkData = False
    msg = "Input parameter tw failed to collect data"
    ghenv.Component.AddRuntimeMessage(gh.Kernel.GH_RuntimeMessageLevel.Warning, msg)

if not material:
    checkData = False
    msg = "Input parameter material failed to collect data"
    ghenv.Component.AddRuntimeMessage(gh.Kernel.GH_RuntimeMessageLevel.Warning, msg)



if checkData:
    Section = alpaca.I_Section(secName, Bsup, tsup, Binf, tinf, H, tw, material)
# ---------- end is ----------
toggle = BooleanToggle(True)
pt = Point([Point(0, 0, 0), Point(11, 0, 0)])
fbc = ForceBeamColumnAlpaca4d(Line=shatter, Section=is)  # -> out, Element; inputs Line: Curve, Colour: Color, Z_Axis: Vector3d
# ---------- fbc: Python ----------
"""
Create a Force Beam Column
-
    Args:
        Line:
        Section:
        Colour:
        Z_Axis:
    Returns:
        Element:
"""

ghenv.Component.Name = "Force Beam Column (Alpaca4d)"
ghenv.Component.NickName = 'FBC'
ghenv.Component.Message = "Force Beam Column (Alpaca4d)"


import sys
import Rhino.Geometry as rg
import Grasshopper as gh
import ghpythonlib.components as ghcomp
from System.Drawing import Color

## add alpaca install directory to system path

ghcompfolder = gh.Folders.DefaultAssemblyFolder
if ghcompfolder not in sys.path:
    sys.path.append(ghcompfolder)

try:
    from Alpaca4d import alpaca4d as alpaca
except:
    msg = "Cannot import Alpaca4d. Is the Alpaca4d folder available in " + ghcompfolder + "?"
    ghenv.Component.AddRuntimeMessage(gh.Kernel.GH_RuntimeMessageLevel.Error, msg)


checkData = True

if not Line:
    checkData = False
    msg = "Input parameter Line failed to collect data"
    ghenv.Component.AddRuntimeMessage(gh.Kernel.GH_RuntimeMessageLevel.Warning, msg)


if not Section:
    checkData = False
    msg = "Input parameter Section failed to collect data"
    ghenv.Component.AddRuntimeMessage(gh.Kernel.GH_RuntimeMessageLevel.Warning, msg)

if not Colour:
    Colour = Color.Red


if not GeomTransf:
    GeomTransf = "Linear"

if checkData:
    
    if not Z_Axis:
        midPoint =  Line.PointAtNormalizedLength(0.5)
        parameter = Line.ClosestPoint(midPoint, 0.01)[1]
        Z_Axis = ghcomp.PerpFrame( Line, parameter )
    Element = alpaca.ForceBeamColumn(Line, Section, GeomTransf, Colour, Z_Axis)
# ---------- end fbc ----------
gl = GravityLoadAlpaca4d(GravityFactor=1)  # -> out, Load
# ---------- gl: Python ----------
"""
Create Gravity Load
-
    Args:
        Pos:
        Force:
        Moment:
        TimeSeries:
    Returns:
        PointLoad:
"""

ghenv.Component.Name = "Gravity Load (Alpaca4d)"
ghenv.Component.NickName = 'GL'
ghenv.Component.Message = "Gravity Load (Alpaca4d)"



import sys
import Rhino.Geometry as rg
import Grasshopper as gh
import copy


## add alpaca install directory to system path

ghcompfolder = gh.Folders.DefaultAssemblyFolder
if ghcompfolder not in sys.path:
    sys.path.append(ghcompfolder)

try:
    from Alpaca4d import alpaca4d as alpaca
except:
    msg = "Cannot import Alpaca4d. Is the Alpaca4d folder available in " + ghcompfolder + "?"
    ghenv.Component.AddRuntimeMessage(gh.Kernel.GH_RuntimeMessageLevel.Error, msg)

if not TimeSeries:
    TimeSeries = alpaca.TimeSeriesConstant(1)

Load = alpaca.GravityLoad(GravityFactor, TimeSeries)
# ---------- end gl ----------
support = SupportAlpaca4d(Pos=pt, Tx=toggle, Ty=toggle, Tz=toggle, Rx=toggle, Ry=toggle, Rz=toggle)  # -> Support; inputs Pos: Point3d, Tx: Boolean, Ty: Boolean, Tz: Boolean, Rx: Boolean, Ry: Boolean, Rz: Boolean
# ---------- support: Python ----------
"""
Create a support
-
    Args:
        Pos:
        Tx:
        Ty:
        Tz:
        Rx:
        Ry:
    Returns:
        Support:
"""

ghenv.Component.Name = "Support (Alpaca4d)"
ghenv.Component.NickName = 'Support'
ghenv.Component.Message = "Support (Alpaca4d)"


import sys
import Rhino.Geometry as rg
import Grasshopper as gh


## add alpaca install directory to system path

ghcompfolder = gh.Folders.DefaultAssemblyFolder
if ghcompfolder not in sys.path:
    sys.path.append(ghcompfolder)

try:
    from Alpaca4d import alpaca4d as alpaca
except:
    msg = "Cannot import Alpaca4d. Is the Alpaca4d folder available in " + ghcompfolder + "?"
    ghenv.Component.AddRuntimeMessage(gh.Kernel.GH_RuntimeMessageLevel.Error, msg)

checkData = True


if not Pos:
    checkData = False
    msg = "Input parameter Pos failed to collect data"
    ghenv.Component.AddRuntimeMessage(gh.Kernel.GH_RuntimeMessageLevel.Warning, msg)

if checkData:
    Support = alpaca.Support(Pos, Tx, Ty, Tz, Rx, Ry, Rz)
# ---------- end support ----------
am = AssembleModelAlpaca4d(Element=flatten(fbc.Element), Support=flatten(support), Load=flatten(gl.Load))  # -> out, AlpacaModel, Mass; inputs Element: list, Support: list, Load: list, Constraint: list
# ---------- am: Python ----------
"""
Create a FEA Model
-
    Args:
        Element:
        Support:
        Load:
        Constraint:
    Returns:
        AlpacaModel:
"""


import os
import sys
import ghpythonlib.treehelpers as th
import Rhino.Geometry as rg
import Rhino.Collections as rc
import rhinoscriptsyntax as rs
from collections import defaultdict, OrderedDict, deque
import copy
import time
import Grasshopper as gh



ghenv.Component.Name = "Assemble Model (Alpaca4d)"
ghenv.Component.NickName = 'AM'
ghenv.Component.Message = "Assemble Model (Alpaca4d)"


## add alpaca install directory to system path

ghcompfolder = gh.Folders.DefaultAssemblyFolder
if ghcompfolder not in sys.path:
    sys.path.append(ghcompfolder)

try:
    from Alpaca4d import alpaca4d as alpaca
    from Alpaca4d import alpaca4dUtil as alpacaUtil
except:
    msg = "Cannot import Alpaca4d. Is the Alpaca4d folder available in " + ghcompfolder + "?"
    ghenv.Component.AddRuntimeMessage(gh.Kernel.GH_RuntimeMessageLevel.Error, msg)


checkData = True

if not Element:
    checkData = False
    msg = "Input parameter Element failed to collect data"
    ghenv.Component.AddRuntimeMessage(gh.Kernel.GH_RuntimeMessageLevel.Warning, msg)

if not Support:
    checkData = False
    msg = "Input parameter Support failed to collect data"
    ghenv.Component.AddRuntimeMessage(gh.Kernel.GH_RuntimeMessageLevel.Warning, msg)


if checkData:
    
    FolderPath = rs.DocumentPath()
    os.chdir(FolderPath)
    
    # create the object model
    AlpacaModel = alpaca.Model()
    
    
    start = time.clock()
    #subdivide element per type
    
    for element in Element:
        if element.type == "Beam":
            AlpacaModel.beams.append(element)
        elif element.type == "Shell":
            AlpacaModel.shells.append(element)
        elif element.type == "Brick":
            AlpacaModel.bricks.append(element)
    
    
    end = time.clock() - start
    print("time to subdivide element {}".format(end))
    start = time.clock()
    
    # create a list of unique point
    # need to add the rigid constraint
    
    AlpacaModel.getuniquePoints(AlpacaModel.beams, AlpacaModel.shells, AlpacaModel.bricks, Constraint)
    
    
    end = time.clock() - start
    print("time to get uniquepoints {}".format(end))
    start = time.clock()
    
    
    #############
    # create node and assign to object
    #############
    
    if AlpacaModel.uniquePointsThreeNDF:
        AlpacaModel.py.append(alpaca.Model.write3ndf_tcl())
        for point in AlpacaModel.uniquePointsThreeNDF:
            node = alpaca.Node(point)
            node.ndf = 3
            node.setNodeTag(AlpacaModel)
            AlpacaModel.nodes.append( node )
        
            AlpacaModel.py.append(node.write_tcl())
    
    
    if AlpacaModel.uniquePointsSixNDF:
        AlpacaModel.py.append(alpaca.Model.write6ndf_tcl())
        for point in AlpacaModel.uniquePointsSixNDF:
            node = alpaca.Node(point)
            node.ndf = 6
            node.setNodeTag(AlpacaModel)
            AlpacaModel.nodes.append( node )
         
            AlpacaModel.py.append(node.write_tcl())
    
    
    
    end = time.clock() - start
    print("time to create node and assign tag {}".format(end))
    start = time.clock()
    
    
    #################
    # create supports
    #################
    
    for supportNode in Support:
        
        # if the list is empty, skip this operation
        if AlpacaModel.uniquePointsThreeNDF:
            closestPointInThreeNDF = rc.Point3dList.ClosestPointInList(AlpacaModel.uniquePointsThreeNDF, supportNode.Pos)
            if supportNode.Pos.DistanceTo(closestPointInThreeNDF) < 0.001:
                #print("I am in 3ndf")
                supportNode.ndf = 3
                AlpacaModel.threeNDFModel.append(supportNode)
                supportNode.setNodeTag(AlpacaModel)
        
        if AlpacaModel.uniquePointsSixNDF:
            closestPointInSixNDF = rc.Point3dList.ClosestPointInList(AlpacaModel.uniquePointsSixNDF, supportNode.Pos)
            if supportNode.Pos.DistanceTo(closestPointInSixNDF) < 0.001:
                supportNode.ndf = 6
                AlpacaModel.sixNDFModel.append(supportNode)
                supportNode.setNodeTag(AlpacaModel)
        
        
        AlpacaModel.supports.append(supportNode)
        AlpacaModel.py.append(supportNode.write_tcl())
    
    
    end = time.clock() - start
    print("time to create support and assign tag {}".format(end))
    start = time.clock()
    
    
    ####################
    # create constraints
    ####################
    
    
    for constraint in Constraint:
        constraint.setNodeTag(AlpacaModel)
        AlpacaModel.constraints.append(constraint)
    
    ####################
    # create equalDOF when the model has 3df and 6df together
    ####################
    
    
    end = time.clock() - start
    print("time to create constraint and assign tag {}".format(end))
    start = time.clock()
    
    
    Id = []
    IdB = []
    
    def SearchCallback(sender, e):
        Id.Add(e.Id)
        IdB.Add(e.IdB)
    
    
    
    lenThreeNDF = len(AlpacaModel.uniquePointsThreeNDF)
    lenSixNDF = len(AlpacaModel.uniquePointsSixNDF)
    
    
    if not(lenThreeNDF == 0 or lenSixNDF == 0):
        print("brick and beam together")
        rg.RTree.SearchOverlaps(AlpacaModel.RTreeCloudPointThreeNDF, AlpacaModel.RTreeCloudPointSixNDF, 0.001, SearchCallback)
        
        for i,j in zip(Id, IdB):
            print(i,j)
            node_i = AlpacaModel.uniquePointsThreeNDF[i]
            node_j = AlpacaModel.uniquePointsSixNDF[j]
            
            #index_i = AlpacaModel.cloudPoint.ClosestPoint(node_i) + 1
            #index_j = AlpacaModel.cloudPoint.ClosestPoint(node_j) + 1
            
            equalConstraint = alpaca.EqualDOF(node_i, node_j, True, True, True, False, False, False)
            equalConstraint.masterNodeTag = AlpacaModel.cloudPointThreeNDF.ClosestPoint(node_i) + 1
            equalConstraint.slaveNodesTag = AlpacaModel.cloudPointSixNDF.ClosestPoint(node_j) + 1 + len(AlpacaModel.uniquePointsThreeNDF)
            AlpacaModel.py.append(equalConstraint.write_tcl())
    
    
    
    end = time.clock() - start
    print("time to find common points between 3ndf and 6ndf {}".format(end))
    start = time.clock()
    
    ##########################
    ##########################
    ##########################
    
    crossSection = []
    material = []
    
    for item in Element:
        if item.type != "Brick":
            crossSection.append(item.CrossSection)
            material.append(item.CrossSection.material)
        else:
            material.extend(item.material)
        
    
    uniqueCS = list(set(crossSection))
    
    
    flatten_material = alpacaUtil.flatten_list(material)
    
    
    uniqueMaterial = list(set(flatten_material))
    
    for index, material in enumerate(uniqueMaterial,1):
        material.matTag = index
        AlpacaModel.py.append(material.write_tcl())
    
    
    for index, section in enumerate(uniqueCS,1):
        section.sectionTag = index
        AlpacaModel.py.append(section.write_tcl())
        
    
    
    
    
    
    # write py file
    
    
    # assign tag and node Index to element and shell
    for index, element in enumerate(Element,1):
        element.setTopologyRTree(AlpacaModel)
        element.eleTag = index
        element.setTags()
    
    
    
    end = time.clock() - start
    print("time to assign tags for the elements {}".format(end))
    start = time.clock()
    
    
    
    
    
    
    Mass = 0
    IsGravity = False
    g_factor = 10.00
    
    for item in Load:
        if item.type == "Gravity Load":
            IsGravity = True
            GravityLoad = item
        if item.type == "PointLoad":
            AlpacaModel.loads.append(item)
        if item.type == "Mass":
            AlpacaModel.masses.append(item)
    
    
    for item in Element:
        if item.type == "Beam":
            length = item.Crv.GetLength()
            Mass += (item.massDens * length)
            if IsGravity:
                gravityPointLoad_1 = alpaca.PointLoad(item.Crv.PointAtStart, g_factor * rg.Vector3d(0,0, -(item.massDens * length / 2)) * GravityLoad.GravityFactor, rg.Vector3d(0,0,0), GravityLoad.TimeSeries)
                gravityPointLoad_2 = alpaca.PointLoad(item.Crv.PointAtEnd, g_factor * rg.Vector3d(0,0, -(item.massDens * length / 2)) * GravityLoad.GravityFactor, rg.Vector3d(0,0,0), GravityLoad.TimeSeries)
                ##print( -(item.massDens * length / 2))
                AlpacaModel.loads.append(gravityPointLoad_1)
                AlpacaModel.loads.append(gravityPointLoad_2)
        if item.type == "Shell":
            meshArea = rg.AreaMassProperties.Compute(item.Mesh).Area
            if item.CrossSection.__class__.__name__ != "LayeredShell":
                areaDensity = item.CrossSection.thickness * item.CrossSection.material.rho
                Mass += areaDensity * meshArea
                if IsGravity:
                    for vertex in item.Mesh.Vertices.ToPoint3dArray():
                        gravityPointLoad = alpaca.PointLoad(vertex, g_factor * rg.Vector3d(0,0, -(areaDensity * meshArea/ len(item.Mesh.Vertices))) * GravityLoad.GravityFactor, rg.Vector3d(0,0,0), GravityLoad.TimeSeries)
                        AlpacaModel.loads.append(gravityPointLoad)
            else:
                for thickness, material in zip(item.CrossSection.thickness, item.CrossSection.material):
                    areaDensity = thickness * material.rho
                    Mass += areaDensity * meshArea
                    if IsGravity:
                        for vertex in item.Mesh.Vertices.ToPoint3dArray():
                            gravityPointLoad = alpaca.PointLoad(vertex, g_factor * rg.Vector3d(0,0, -(areaDensity * meshArea/ len(item.Mesh.Vertices))) * GravityLoad.GravityFactor, rg.Vector3d(0,0,0), GravityLoad.TimeSeries)
                            AlpacaModel.loads.append(gravityPointLoad)


        if item.type == "Brick":
            #print(type(item.Mesh))
            meshVolume = rg.VolumeMassProperties.Compute(item.Mesh).Volume
            density = item.material.rho 
            Mass += density * meshVolume
            if IsGravity:
                for vertex in item.Mesh.Vertices.ToPoint3dArray():
                    gravityPointLoad = alpaca.PointLoad(vertex, g_factor * rg.Vector3d(0,0, -(density * meshVolume / len(item.Mesh.Vertices))) * GravityLoad.GravityFactor, rg.Vector3d(0,0,0), GravityLoad.TimeSeries)
                    #print(len(item.Mesh.Vertices))
                    #print(density)
                    # volume can be zero if mesh faces are not properly rotated
                    #print(meshVolume)
                    #print(-(density * meshVolume / len(item.Mesh.Vertices)))
                    AlpacaModel.loads.append(gravityPointLoad)
    
    #print(AlpacaModel.loads)
    ## load
    
    
    for item in AlpacaModel.loads:
        item.setNodeTag(AlpacaModel)
    
    #print(AlpacaModel.loads)
    
    for item in AlpacaModel.beams:
        AlpacaModel.py.append(item.write_tcl())
    
    for item in AlpacaModel.shells:
        AlpacaModel.py.append(item.write_tcl())
    
    for item in AlpacaModel.bricks:
        AlpacaModel.py.append(item.write_tcl())
    
    
    for item in Constraint:
        AlpacaModel.py.append(item.write_tcl())
    
    
    for item in AlpacaModel.masses:
        item.setNodeTag(AlpacaModel)
        AlpacaModel.py.append(item.write_tcl())
    
    
    timeSeriesDict = alpaca.TimeSeries.getTimeSeries(AlpacaModel.loads)[1]
    AlpacaModel.py.append(alpaca.PointLoad.write_tcl(timeSeriesDict,AlpacaModel))
    
    
    text = AlpacaModel.py
# ---------- end am ----------
as = AnalysesStepsAlpaca4d(numIncr="1")  # -> AnalysisSteps; inputs numIncr: Int32
# ---------- as: Python ----------
"""
Define the Analysis Step
-
    Inputs:
        numIncr:
        dt:
        dtMin:
        dtMAx:
        Jd:
    Output:
        AnalysisSteps:
"""



ghenv.Component.Name = "Analyses Steps (Alpaca4d)"
ghenv.Component.NickName = 'AS'
ghenv.Component.Message = "Analyses Steps (Alpaca4d)"
ghenv.Component.IconDisplayMode = ghenv.Component.IconDisplayMode.application
ghenv.Component.Category = "Alpaca4d"
ghenv.Component.SubCategory = "7_Analysis"



import sys
import Rhino.Geometry as rg
import Grasshopper as gh
import ghpythonlib.components as ghcomp
from System.Drawing import Color

## add alpaca install directory to system path

ghcompfolder = gh.Folders.DefaultAssemblyFolder
if ghcompfolder not in sys.path:
    sys.path.append(ghcompfolder)

try:
    from Alpaca4d import alpaca4d as alpaca
except:
    msg = "Cannot import Alpaca4d. Is the Alpaca4d folder available in " + ghcompfolder + "?"
    ghenv.Component.AddRuntimeMessage(gh.Kernel.GH_RuntimeMessageLevel.Error, msg)

dt = "" if dt is None else dt
dtMin = "" if dtMin is None else dtMin
dtMax = "" if dtMax is None else dtMax
Jd = "" if Jd is None else Jd

checkData = True

if not numIncr:
    checkData = False
    msg = "Input parameter numIncr failed to collect data"
    ghenv.Component.AddRuntimeMessage(gh.Kernel.GH_RuntimeMessageLevel.Warning, msg)

if checkData:
    AnalysisSteps = alpaca.AnalysisSteps(numIncr, dt, dtMin, dtMax, Jd)
# ---------- end as ----------
as_2 = AnalysisSettingsAlpaca4d(AnalysisSteps=as)  # -> out, Settings
# ---------- as_2: Python ----------
"""
Create Analysis settings
-
    Args:
        Damping: 
        Constraint: 'Plain', 'Transformation'. Default is 'Transformation'.
        Numberer: 'RCM', 'AMD', 'Plain'. Default is 'RCM'.
        System: 'BandGen', 'BandSPD', 'ProfileSPD', 'SuperLU', 'UmfPack', 'FullGeneral', 'SparseSYM'. Default is 'BandSPD'.
        Test: Feature not implemented. Please contact alpaca4d@gmail.com 
        Algorithm: 'Linear', 'Newton', 'NewtonLineSearch', 'ModifiedNewton', 'KrylovNewton', 'SecantNewton', 'BFGS', 'Broyden'. Default is 'Linear'.
        Integrator: Default is LoadControl.
        AnalysisType: 'Static', 'Transient'. Default is 'Static'.
        AnalyesSteps:
    Returns:
        Analysis:
"""

import sys
import os


import clr
import clrtype
import Rhino.Geometry as rg
import rhinoscriptsyntax as rs
import Grasshopper as gh
import copy
import ghpythonlib.treehelpers as th


ghenv.Component.Name = "Analysis settings (Alpaca4d)"
ghenv.Component.NickName = 'AS'
ghenv.Component.Message = "Analysis settings \n(Alpaca4d)"



from Alpaca4d import alpaca4d as alpaca

checkData = True



Damping = None if Damping is None else Damping


# default Value
Constraint = 'Transformation' if Constraint is None else Constraint
ConstraintList = ['Plain', 'Transformation']

for item in ConstraintList:
    if Constraint.lower() == item.lower():
        Constraint = item


# default Value
Numberer = 'RCM' if Numberer is None else Numberer
NumbererList = ['RCM', 'AMD', 'Plain', 'ParallelPlain', 'ParallelRCM']

for i,item in enumerate(NumbererList):
    if Numberer.lower() == item.lower():
        Numberer = item



# default Value
System = 'BandSPD' if System is None else System
SystemList = ['BandGen', 'BandSPD', 'ProfileSPD', 'SuperLU', 'UmfPack', 'FullGeneral', 'SparseSYM']

for i,item in enumerate(SystemList):
    if System.lower() == item.lower():
        System = item


# default Test
Test = 'NormDispIncr 1.0e-6 12 5' if Test is None else Test




# default Value
Algorithm = 'Linear' if Algorithm is None else Algorithm
AlgorithmList = ['Linear', 'Newton', 'NewtonLineSearch', 'ModifiedNewton', 'KrylovNewton', 'SecantNewton', 'BFGS', 'Broyden']

for i,item in enumerate(AlgorithmList):
    if Algorithm.lower() == item.lower():
        Algorithm = item


# default Value
AnalysisType = 'Static' if AnalysisType is None else AnalysisType
AnalysisTypeList = ['Static', 'Transient']

for item in AnalysisTypeList:
    if AnalysisType.lower() == item.lower():
        AnalysisType = item



## Define Integrator
if AnalysisType == "Static":
    Integrator = "LoadControl 1.0" if Integrator is None else Integrator
elif AnalysisType == "Transient":
    Integrator = "Newmark 0.5 0.25" if Integrator is None else Integrator


if AnalysisType == 'Transient':
    if not Damping:
        checkData = False
        msg = "Input parameter Damping failed to collect data"
        ghenv.Component.AddRuntimeMessage(gh.Kernel.GH_RuntimeMessageLevel.Warning, msg)


if not AnalysisSteps:
    checkData = False
    msg = "Input parameter AnalysisSteps failed to collect data"
    ghenv.Component.AddRuntimeMessage(gh.Kernel.GH_RuntimeMessageLevel.Warning, msg)




if checkData:
    Settings = alpaca.Analysis(Constraint, Numberer, System, Test, Algorithm, Integrator, AnalysisType, AnalysisSteps, Damping)
    print(Settings.write_tcl())
# ---------- end as_2 ----------
ra = RunAnalysisAlpaca4d(AlpacaModel=am.AlpacaModel, Settings=as_2.Settings)  # -> log, AlpacaSolvedModel
# ---------- ra: Python ----------
"""
Run an OpenSees Analysis
-
    Args:
        AlpacaModel:
        Settings:
    Returns:
        AlpacaSolvedModel:
"""



import Rhino.RhinoDoc
import Grasshopper as gh
import copy
import rhinoscriptsyntax as rs
import os
import time
import sys



ghenv.Component.Name = "Run Analysis (Alpaca4d)"
ghenv.Component.NickName = 'RA'
ghenv.Component.Message = "Run Analysis (Alpaca4d)"

ghcompfolder = gh.Folders.DefaultAssemblyFolder
if ghcompfolder not in sys.path:
    sys.path.append(ghcompfolder)

try:
    from Alpaca4d import alpaca4d as alpaca
except:
    msg = "Cannot import Alpaca4d. Is the Alpaca4d folder available in " + ghcompfolder + "?"
    ghenv.Component.AddRuntimeMessage(gh.Kernel.GH_RuntimeMessageLevel.Error, msg)


checkData = True



if not AlpacaModel:
    checkData = False
    msg = "Input parameter AlpacaModel failed to collect data"
    ghenv.Component.AddRuntimeMessage(gh.Kernel.GH_RuntimeMessageLevel.Warning, msg)


if not Settings:
    checkData = False
    msg = "Input parameter Settings failed to collect data"
    ghenv.Component.AddRuntimeMessage(gh.Kernel.GH_RuntimeMessageLevel.Warning, msg)


if checkData:
    FolderPath = rs.DocumentPath()
    os.chdir(FolderPath)
    
    outputFileName = 'openSeesModel'
    recorderFileName = 'recorder.mpco'
    
    for dirpath, dirnames, filenames in os.walk(FolderPath):
        for filename in filenames:
            if filename == outputFileName:
                file = os.path.join(dirpath,outputFileName)
                os.remove(file)
            elif filename == recorderFileName:
                file = os.path.join(dirpath,recorderFileName)
                os.remove(file)
    
    
    # create a copy
    
    AnalysisModel = copy.copy(AlpacaModel)
    AnalysisModel.py = list(AnalysisModel.py)
    
    # generate Recorder and assign name
    AnalysisModel.recorderName = "recorder" + ".mpco"
    
    AnalysisModel.py.append(alpaca.TCLRecorder.mpco(AnalysisModel.recorderName, True,True,True,True,False,False,True,True,True,True))
    
    
    AnalysisModel.analysis = Settings
    AnalysisModel.py.append(Settings.write_tcl())
    AnalysisModel.py.append("wipe")
    
    
    #textFile = AnalysisModel.py
    
    time_start = time.clock()
    
    AnalysisModel.writeFile(outputFileName)
    
    time_elapsed = (time.clock() - time_start)
    print("Writing Time {}".format(time_elapsed))
    
    
    
    time_start = time.clock()
    
    executable = os.path.join(ghcompfolder,'Alpaca4d\OpenSees-Solvers\opensees.bat')
    a, log = AnalysisModel.runOpensees(executable)
    
    
    time_elapsed = (time.clock() - time_start)
    print("Analyses Time {}".format(time_elapsed))
    
    AlpacaSolvedModel = copy.copy(AnalysisModel)
    AlpacaSolvedModel.isAnalysed = True
# ---------- end ra ----------
bf = BeamForcesAlpaca4d(AlpacaModel=ra.AlpacaSolvedModel, History=False)  # -> out, simplify(N), M2, T1, M1, T2, Mz; inputs History: Boolean, step: Int32
# ---------- bf: Python ----------
"""
Read Beam Forces

    Args:
        AlpacaModel:
        History:
        step:
    Returns:
        N: forces in direction 3  (Axial Force)
        M2: Moments around axis 2 (Bending Moment 1)
        T1: forces in direction 1 (Shear Force 1)
        M1: Moments around axis 1 (Bending Moment 2)
        T2: forces in direction 2 (Shear Force 2)
        Mt: Moments around axis 3 (Twisting Moment)
"""

import sys
import os
import System
from System.Drawing import Color
import clr
import clrtype
import Rhino.Geometry as rg
import rhinoscriptsyntax as rs
import Grasshopper as gh
import copy
import ghpythonlib.treehelpers as th


ghenv.Component.Name = "Beam Forces (Alpaca4d)"
ghenv.Component.NickName = 'BF'
ghenv.Component.Message = "Beam Forces (Alpaca4d)"
## add alpaca install directory to system path

ghcompfolder = gh.Folders.DefaultAssemblyFolder
if ghcompfolder not in sys.path:
    sys.path.append(ghcompfolder)

try:
    from Alpaca4d import alpaca4d as alpaca
except:
    msg = "Cannot import Alpaca4d. Is the Alpaca4d folder available in " + ghcompfolder + "?"
    ghenv.Component.AddRuntimeMessage(gh.Kernel.GH_RuntimeMessageLevel.Error, msg)



FolderPath = rs.DocumentPath()
os.chdir(FolderPath)


# import costum modules to read the hdf5 file

my_module_name = "Alpaca_StepReader"
my_module = sys.modules.setdefault(my_module_name, type(sys)(my_module_name))

hdfFilePath = os.path.join(ghcompfolder, "Alpaca4d\HDF5CSharp.dll")
clr.AddReferenceToFileAndPath(hdfFilePath)

from HDF5CSharp import Hdf5

try:
    Steps = my_module.Steps
except AttributeError:
    type_2d = type(System.Array.CreateInstance(float, 1, 1))

    class Steps(object):
        __metaclass__ = clrtype.ClrClass
        _clrfields = {"STEP_{}".format(i): type_2d for i in range(1000)} # it will work for model with less than 1000 steps

    my_module.Steps = Steps


checkData = True

if not AlpacaModel:
    checkData = False
    msg = "Input parameter AlpacaModel failed to collect data"
    ghenv.Component.AddRuntimeMessage(gh.Kernel.GH_RuntimeMessageLevel.Warning, msg)

if checkData:
    
    step = (int(AlpacaModel.analysis.AnalysisSteps.numIncr) - 1) if step is None else step
    
    N = []
    T1 = []
    T2 = []
    M1 = []
    M2 = []
    Mz = []
    
    fileId = Hdf5.OpenFile(AlpacaModel.recorderName, True)
    
    stressResult = Hdf5.ReadObject[Steps](fileId, "/MODEL_STAGE[1]/RESULTS/ON_ELEMENTS/section.force/74-ForceBeamColumn3d[1000:1:0]/DATA")
    if History is True:
        try:
            maxNumberStep = int(AlpacaModel.analysis.AnalysisSteps.numIncr)
        
        
            for i,item in enumerate(AlpacaModel.beams):
                
                Ni = []
                M2i = []
                T1i = []
                
                M1i = []
                T2i = []
                Mzi = []
                
                for istep in range(maxNumberStep):
                
                    ni = 5 # potrebbe cambiare per ogni trave
                    Ni.append([getattr(stressResult, 'STEP_{}'.format(istep))[i,j] for j in range(0,ni*6, 6)])
                    M2i.append([ getattr(stressResult, 'STEP_{}'.format(istep))[i,j] for j in range(1,ni*6, 6)])
                    T1i.append([ getattr(stressResult, 'STEP_{}'.format(istep))[i,j] for j in range(2,ni*6, 6)])
                    M1i.append([ getattr(stressResult, 'STEP_{}'.format(istep))[i,j] for j in range(3,ni*6, 6)])
                    T2i.append([ getattr(stressResult, 'STEP_{}'.format(istep))[i,j] for j in range(4,ni*6, 6)])
                    Mzi.append([ getattr(stressResult, 'STEP_{}'.format(istep))[i,j] for j in range(5,ni*6, 6)])
                
                N.append([Ni])
                M2.append([M2i])
                T1.append([T1i])
                M1.append([M1i])
                T2.append([T2i])
                Mz.append([Mzi])
            Hdf5.CloseFile(fileId)
            print("I have closed the file")
        except:
            Hdf5.CloseFile(fileId)
            print("I have closed the file")
    elif History == False:
        try:
            for i,item in enumerate(AlpacaModel.beams):
                ni = 5 # potrebbe cambiare per ogni trave
                Ni = [ getattr(stressResult, 'STEP_{}'.format(step))[i,j] for j in range(0,ni*6, 6)]
                M2i = [ getattr(stressResult, 'STEP_{}'.format(step))[i,j] for j in range(1,ni*6, 6)]  
                T1i = [ getattr(stressResult, 'STEP_{}'.format(step))[i,j] for j in range(2,ni*6, 6)]
                M1i = [ getattr(stressResult, 'STEP_{}'.format(step))[i,j] for j in range(3,ni*6, 6)]
                T2i = [ getattr(stressResult, 'STEP_{}'.format(step))[i,j] for j in range(4,ni*6, 6)]
                Mzi = [ getattr(stressResult, 'STEP_{}'.format(step))[i,j] for j in range(5,ni*6, 6)]
                
                N.append([Ni])
                M2.append([M2i])
                T1.append([T1i])
                M1.append([M1i])
                T2.append([T2i])
                Mz.append([Mzi])
            
            Hdf5.CloseFile(fileId)
            print("I have closed the file")
        
        except:
            Hdf5.CloseFile(fileId)
            print("I have closed the file")
    
    
    
    N = th.list_to_tree(N)
    M2 = th.list_to_tree(M2)
    T1 = th.list_to_tree(T1)
    M1 = th.list_to_tree(M1)
    T2 = th.list_to_tree(T2)
    Mz = th.list_to_tree(Mz)
# ---------- end bf ----------
num = Number(expr("x*0.000001", bf.M1))
num_2 = Number(expr("x*0.000001", bf.T2))
num_3 = Number(expr("x*0.000001", bf.Mz))
num_4 = Number(expr("x*0.000001", bf.M2))
num_5 = Number(expr("x*0.000001", bf.T1))
number_slider = Slider(50, range=0..100)
rhs_section = GhPythonScript(
    AlpacaSolvedModel=ra.AlpacaSolvedModel,
    Lb="150",
    Ned=bf.N,
    Vedy=num_5,
    Vedz=num_2,
    T=num_3,
    Medy=num_4,
    Medz=num,
    Lcry=number_slider,
    Lcrz=number_slider,
    type="0")  # -> out, combineUtilisation, shearUtilisation, combine_Utilisation
# ---------- rhs_section: Python ----------
#section capacity check I-Section

import Rhino.Geometry as rg
import math


def classSection_I_Compression(var_set):  
    c_web= h-tf_top- tf_bottom
    c_flange_top = (tf_top-tw)/2
    c_flange_bottom = (tf_bottom-tw)/2

    if (b_bottom != b_top) or (tf_top != tf_bottom):  #check if unsymmetrical I-section, considering elasric capacity always
        
        if (c_web/tw <= 42*epsilon) and (i<=14*epsilon for i in [c_flange_top/tf_top, c_flange_bottom/tf_bottom]) :
            classSection = 3
        else:
            raise ValueError('section unsymmetrical and in class 4')
    else:
        if c_web/tw <= 33 * epsilon and (i<=9*epsilon for i in [c_flange_top/tf_top,c_flange_bottom/tf_bottom]):
            classSection = 1
        elif c_web/tw <= 38 * epsilon and (i<=10*epsilon for i in [c_flange_top/tf_top,c_flange_bottom/tf_bottom]) :
            classSection = 2
        elif c_web/tw <= 42 * epsilon and (i<=14*epsilon for i in [c_flange_top/tf_top,c_flange_bottom/tf_bottom]):
            classSection = 3
        else:
            raise ValueError('section in class 4')
    
    return classSection


def classSection_I_Moment(var_set):  
    c_web= h-tf_top- tf_bottom
    c_flange_top = (tf_top-tw)/2
    c_flange_bottom = (tf_bottom-tw)/2

    if b_bottom != b_top or tf_top != tf_bottom:  #check if unsymmetrical I-section, considering elastic capacity always, check in with marco
        if c_web/tw <= 124*epsilon and (i<=14*epsilon for i in [c_flange_top/tf_top,c_flange_bottom/tf_bottom]):
            classSection=3
        else: 
            raise ValueError('section unsymmetrical and in class 4')

    else:
        if c_web/tw <= 72 * epsilon and (i<=9*epsilon for i in [c_flange_top/tf_top,c_flange_bottom/tf_bottom]):
            classSection = 1
        elif c_web/tw <= 83 * epsilon and (i<=10*epsilon for i in [c_flange_top/tf_top,c_flange_bottom/tf_bottom]):
         classSection = 2
        elif c_web/tw <= 124 * epsilon and (i<=14*epsilon for i in [c_flange_top/tf_top,c_flange_bottom/tf_bottom]):
            classSection = 3
        else:
            raise ValueError('section in class 4')
    return classSection

#class section for compression in Z
def classSection_I_Compression_Moment(var_set):  
    c_web= h-tf_top- tf_bottom
    c_flange_top = (tf_top-tw)/2
    c_flange_bottom = (tf_bottom-tw)/2

    alpha_local_web= 0.5*(1+ abs(Ned)/(fy*c_web*tw))
    alpha_local_flange_top= 0.5*(1+ abs(Ned)/(fy*c_flange_top*tf_top))    # check if c*tf is correct for area
    alpha_local_flange_bottom=0.5*(1+ abs(Ned)/(fy*c_flange_bottom*tf_bottom))

    psi_web= 2*Ned/(c_web*tw*fy) - 1
    psi_flange_top= 2*Ned/(c_flange_top*tf_top*fy) - 1
    psi_flange_bottom= 2*Ned/(c_flange_bottom*tf_bottom*fy) - 1

    if psi_flange_top == 1 :
        k_sigma_top= 0.43
    elif 0< psi_flange_top < 1 :
        k_sigma_top = 0.578/(psi_flange_top + 0.34)
    elif psi_flange_top == 0:
        k_sigma_top= 1.7
    elif -1< psi_flange_top< 0 :
        k_sigma_top = 1.7 - 5*psi_flange_top + 17.1*psi_flange_top**2
    elif psi_flange_top == -1 :
        k_sigma_top= 23.8
    

    if psi_flange_bottom == 1 :
        k_sigma_bottom= 0.43
    elif 0< psi_flange_bottom < 1 :
        k_sigma_bottom = 0.578/(psi_flange_bottom + 0.34)
    elif psi_flange_bottom == 0 :
        k_sigma_bottom= 1.7
    elif -1< psi_flange_bottom< 0 :
        k_sigma_bottom = 1.7 - 5*psi_flange_bottom + 17.1*psi_flange_bottom**2
    elif psi_flange_bottom == -1 :
        k_sigma_bottom= 23.8
    

    if alpha_local_web >0.5:
        class_1_limit= 396*epsilon/(13*alpha_local_web - 1)
        class_2_limit= 456*epsilon/(13*alpha_local_web - 1)
    else :
        class_1_limit= 36*epsilon/alpha_local_web
        class_2_limit= 41.5*epsilon/alpha_local_web

    if psi_web > -1:
        class_3_limit = 42*epsilon/(0.67 + 0.33*psi_web)
    else :
        class_3_limit= 62*epsilon*(1-psi_web)*math.sqrt(abs(psi_web))



    if b_bottom != b_top or tf_top != tf_bottom:  #check if unsymmetrical I-section, considering elasric capacity always
        if c_web/tw <= class_3_limit and c_flange_top/tf_top<= 21*epsilon*math.math.sqrt(k_sigma_top) and c_flange_bottom/tf_bottom<=21*epsilon*math.math.sqrt(k_sigma_bottom):
            classSection = 3
        else: 
           raise ValueError('section Unsymmetrical and in class 4') 
    else:
        if c_web/tw <= class_1_limit and c_flange_top/tf_top<=9*epsilon/alpha_local_flange_top and c_flange_bottom/tf_bottom<=9*epsilon/alpha_local_flange_bottom  :
            classSection = 1
        elif c_web/tw <= class_2_limit and c_flange_top/tf_top<=10*epsilon/alpha_local_flange_top and c_flange_bottom/tf_bottom<=10*epsilon/alpha_local_flange_bottom :
            classSection = 2
        elif c_web/tw <= class_3_limit and c_flange_top/tf_top<= 21*epsilon*math.math.sqrt(k_sigma_top) and c_flange_bottom/tf_bottom<=21*epsilon*math.math.sqrt(k_sigma_bottom) :
            classSection = 3
        else:
            raise ValueError('section in class 4')
    return classSection



def shearCheck(var_shear):
    if (h_web/tw > 72*epsilon/eta) :  #only applies for unstiffened webs, have to make an boolean toggle for this
        sigma_E = math.pi**2*E*tw**2/(12*(1-upsilon**2)*h_web**2)     #EN 1993-1-5 , A.1
        k_tau_st = max(9*(h_web/Lb)**2*math.pow(math.pow((Iz_web/tw**3*h_web), 3),1/4) , 2.1*math.pow(Iz_web/h_web,1/3)/tw, 1/3)    #Lb= a EN 1993-1-5 , A.3
        k_tau = 5.34 + 4*(h_web/Lb)**2 + k_tau_st # if a/h_web <=1 , else k_tau = 4 + 5.34*(h_web/Lb)**2 + k_tau_st - ignore for web without stiffner only
        lamda_w = 0.76*math.sqrt(fy/(k_tau*sigma_E))
        if lamda_w < 0.83/eta:   #1993-1-5 , 5.2
            chi_w = eta  
        elif 0.83/eta <= lamda_w < 1.08 :
            chi_w = 0.83/lamda_w
        else:
            chi_w = 1.37/(0.7 + lamda_w)
        
        VplRdy = chi_w*fy*h_web*tw/(math.sqrt(3)*gamma_M1)
    else: 
        VplRdy = (Av_y * (fy/math.sqrt(3)) )/gamma_M0
    
    VplRdz = (Av_z * (fy/math.sqrt(3)) ) / gamma_M0

    if T !=0 :
        tau_ed_web = T_vernant/tw  #shear stress due to torsion, where T is saint venant torsion
        tau_ed_flange = T_vernant/min(tf_bottom,tf_top)
    VplRdy = (1-(tau_ed_web/(fy/math.sqrt(3)/ gamma_M0)))*VplRdy
    VplRdz = (1-(tau_ed_flange/(fy/math.sqrt(3)/ gamma_M0)))*VplRdz
    shearUtilisation_y = Vedy/VplRdy # for combined shear in both direction
    shearUtilisation_z = Vedz/VplRdz
    
    return VplRdy, VplRdz, shearUtilisation_y, shearUtilisation_z

def Moment_check(var_set) :
    #section modulus check
    if classSection == 3:
        Wly = Iy/max(cy_pos, cy_neg) #elastic modulus y-y
        Wlz = Iz/max(b_top, b_bottom) #elastic modulus z-z
    elif classSection == 1 or 2 :
        Wly= (h-cy_neg-tf_bottom)**2*tw/2 + b_bottom*tf_bottom*(cy_pos-(tf_bottom/2))  #plastic modulus y-y
        Wlz = (A3*b_top+ A1*b_bottom)/4    #plastic modulus z-z
    else:
        raise valueerror('section in Class4, too slender')

    MRdy = Wly*fy/gamma_M0 
    MRdz = Wlz*fy/gamma_M0

    # 6.2.9 bending + axial
    Ncpr= (Area * fy) / gamma_M0 #compression plastic resistance

    if Ned > 0.25*Ncpr or Ned > 0.5*h_web*tw*fy/gamma_M0:
        n = Ned/Ncpr
        a = min((area - A1- A3)/area, 0.5)
        MRdy = min(MRdy*(1-n/(1- 0.5*a)), MRdy)
    elif Ned > h_web*tw*fy/gamma_M0:
        if n>a:
            MRdz = MRdz*(1- ((n-a)/(1-a))**2)
    
    Ma= 100 #bending moment at quater point have to get Ma,Mb,Mc value from opensees analysis
    Mb = 100 #bending moment at mid point
    Mc = 100 #bending moment at end point
    M_max = 100 #maximum bending moment on the member
    Cb = 12.5*M_max/(2.5*M_max + 3*Ma + 4*Mb + 3*Mc)  # shape factor based on bending diagram (AISC), only applies for moment in Y-Y

    #EN-1993-1-1 6.3.2.2
    k=1 ; k_w = 1  # end rotation factor ; end warping factor, have to include this going forward
    L_ltb = Lb ; k_ltb = 1 #length of unbraced member  # effective length factor for lateral torsional buckling, overriding L_ltb
    L_cr_ltb = L_ltb*k_ltb # effective critical length


    M_cr = Cb*math.pi**2*E*Iz*(math.sqrt((k*Cw/(k_w*Iz)) + (L_cr_ltb**2*G*J/(math.pi**2*E*Iz))))/L_cr_ltb**2  # , M_cr critical Bending moment
    Lamda_lt = math.sqrt(Wly*fy/M_cr)
    beta_lt = 0.75 #recommended value
    Lamda_lt_0 = 0.4 # recommended value

    if type==0 :
        if h/min(b_bottom,b_top) <= 2: #hot rolled sections
            alpha_lt = alpham[1]
        else:
            alpha_lt = alpham[2]
    if type== 1 :
        if h/min(b_bottom,b_top) <= 2:    #cold form section
            alpha_lt = alpham[3]
        else:
            alpha_lt = alpham[4]

    phi_lt = 0.5*(1 + alpha_lt*(Lamda_lt - Lamda_lt_0) + beta_lt*Lamda_lt**2)
    chi_lt = min(1/(phi_lt + math.sqrt(phi_lt**2 - beta_lt*Lamda_lt**2)), 1, 1/(Lamda_lt**2))

    if chi_lt <1:
         MRdy =chi_lt*MRdy

    return MRdy, MRdz 



def Axial_check(var_Axial):

    NplRd = (Area * fy) / gamma_M0
    if Ned <=0 : # - indicates member in tension
        Nrd = NplRd    #require sign to be assigned to tesion force
    else:
        Ncpl =  NplRd
        k_cr_y = 1 ; k_cr_z = 1 ; Lcry= k_cr_y*Lb ; Lcrz= k_cr_z*Lb # k_cr is effective length factor in respective direction

        Ncry = math.pi**2*E*Iy/Lcry**2   #euler critical buckling y direction
        Ncrz = math.pi**2*E*Iz/Lcrz**2   #euler critical buckling z direction
        Lamda_y = math.math.sqrt((Area*fy)/Ncry) ; Lamda_z = math.math.sqrt((Area*fy)/Ncrz) #slenderness ratio
        if type == 0 : #0= hot rolled, 1= cold formed
            if h/min(b_bottom, b_top) >1.2:
                if min(tf_bottom, tf_top) <= 40: #mm:
                    if fy>420: #Mpa:
                        alpha_y = alpham[0] 
                        alpha_z = alpham[0]
                    else:
                        alpha_y = alpham[1] 
                        alpha_z = alpham[2]
                elif 40< min(tf_bottom, tf_top) <= 100 : #mm
                    if fy>420: #Mpa:
                        alpha_y = alpham[1] 
                        alpha_z = alpham[1]
                    else:
                        alpha_y = alpham[2] 
                        alpha_z = alpham[3]
                else:
                    raise ValueError('flange thickness out of limits')
            
            else:
                if min(tf_bottom, tf_top) <= 100 :  #mm:
                    if fy>420: #Mpa:
                        alpha_y = alpham[1] 
                        alpha_z = alpham[1]
                    else:
                        alpha_y = alpham[2] 
                        alpha_z = alpham[3]
                elif  min(tf_bottom, tf_top) >100 : #mm
                    if fy>420: #Mpa:
                        alpha_y = alpham[3] 
                        alpha_z = alpham[3]
                    else:
                        alpha_y = alpham[4] 
                        alpha_z = alpham[4]
                else:
                    raise ValueError('flange thickness out of limits')    
        elif type == 1 :
            if min(tf_bottom, tf_top) <= 40 : #mm:
                alpha_y = alpham[2] 
                alpha_z = alpham[3]
            else:
                alpha_y = alpham[3] 
                alpha_z = alpham[4]

        phi_y= 0.5*(1 + alpha_y*(Lamda_y - 0.2) + Lamda_y**2) 
        phi_z= 0.5*(1 + alpha_z*(Lamda_z - 0.2) + Lamda_z**2)
        chi_yy = 1/(phi_y+ math.sqrt(phi_yy**2 - Lamda_y**2))
        chi_zz = 1/(phi_z+ math.sqrt(phi_zz**2 - Lamda_z**2))

        Nbrd_y= chi_yy*Ncpl ; Nbrd_z= chi_zz*Ncpl
        Nbrd = min(Nbrd_y, Nbrd_z)
        Nrd= min(Ncpl, Nbrd)
    return Nrd


"""
input:
    Depth (h)-mm
    top flange width (b_top)-mm
    bottom flange width (b_bottom)-mm
    Web thickness (tw)-mm
    Top Flange thickness (tf_top)-mm
    Bottom flange Thickness (tf_bottom)-mm
    material properties
    gamma_M0

output:
    tensionUtilisation
    bendingUtilisation
"""

gamma_M0 = 1.0
gamma_M1 = 1.0
gamma_M2 = 1.1




############################
############################
############################
sections = []

for beam in AlpacaSolvedModel.beams:
    sections.append(beam.CrossSection)

for Section in sections:
    upsilon = Section.material.v
    
    E = Section.material.E
    G = Section.material.G
    
    
    # I need to define fy in the material properties class
    fy =355 
    
    eta = 1.2 if fy<= 460 else 1
    
    h = Section.H
    b_top = Section.Bsup
    b_bottom = Section.Binf
    tw = Section.tw
    tf_top = Section.tsup
    tf_bottom = Section.tinf
    
    
    var_set= [h,b_top, b_bottom, tw, tf_top, tf_bottom]
    
    if any(i<=0 for i in var_set):
      raise ValueError('Negative or zero value detected')
    elif any (i<=0.03 for i in var_set) :
        raise ValueError('Thickness is less then 3 mm') 
    
    Area = Section.Area()
    
    
    
    
    #Area = (h*tw) + (b_top-tw)*tf_top + (b_bottom-tw)*tf_bottom
    h_web = h-tf_bottom-tf_top #web height excluding flange thickness
    
    A1= b_bottom*tf_bottom ; y1= tf_bottom/2  #bottom flaneg area
    A2= (h-tf_bottom-tf_top)*tw ; y2= h/2     #web area
    A3= b_top*tf_top ; y3= h/2- tf_top/2      #top flange area
    
    cy_pos = (A1*y1 + A2*y2 + A3*y3)/(A1 + A2 + A3)
    cy_neg = h - cy_pos
    
    Iy1= b_bottom*tf_bottom**3/12; Iy2 = tw*(h-tf_bottom-tf_top)**3/12; Iy3 = b_top*tf_top**3/12   
    Iy = Iy1 + A1*(cy_pos- y1) + Iy2 + A2*(cy_pos- y2) + Iy3 + A3*(cy_pos- y3)
    Iz_web= (h-tf_bottom-tf_top)*tw**3/12
    Iz = tf_bottom*b_bottom**3/12 + Iz_web + tf_top*b_top**3/12
    
    
    alpham = [0.13, 0.21, 0.34, 0.49, 0.76]  #buckling curves
    epsilon = math.sqrt(235/fy)
    
    
    #Shear Area
    Av_z = max(h*tw, eta*A2) #web max area
    Av_y = A1 + A3   #flange area only




[Rx_0, Ry_0, Rz_0,Mxx_0, Myy_0, Rx_1, Ry_1, Rz_1,Mxx_1, Myy_1]= [1,1,1,1,1,1,1,1,1,1]

#Torsional property and checks
if T!=0: 
    h_web_T= h_web + (tf_bottom + tf_top)/2
    #h0 =2*((dy-t) + (dz-t))
    #Ah = (dy-t)*(dz-t)
    J= (b_bottom*tf_bottom**3 + b_top*tf_top**3 + h_web_T*tw**3)/3  #torsional constant
    Cw= h_web_T**2*tf_bottom*tf_top*b_bottom**3*b_top**3/(12*(tf_top*b_top**3 + tf_bottom*b_bottom**3))   #warping constant

    K_t = Lb*math.sqrt(G*J/(E*Cw))

    if [Mxx_0, Myy_0, Mxx_1, Myy_1] == [0,0,0,0] : #Mxx, Myy,MZZ end moment restrain; Rx,Ry,Rz = end translation restrain
        alpha_T = 3.7 ; beta_T = 1.08
    elif [Mxx_0, Myy_0, Mxx_1, Myy_1] == [1,1,1,1] :
        alpha_T = 6.9 ; beta_T = 1.14
    elif [Rx_0, Ry_0, Rz_0, Rx_1, Ry_1, Rz_1] == [0,0,0,1,1,1] or [Rx_0, Ry_0, Rz_0, Rx_1, Ry_1, Rz_1] == [1,1,1,0,0,0]:
        alpha_T = 2.7 ; beta_T = 1.11

    chi_torsion = 1/(beta_T + (alpha_T/K_t)**2)
    T_warp = T*(1-chi_torsion)
    T_vernant = T*chi_torsion
    
    #Trd= Cw*(fy/math.math.sqrt(3))/gamma_M0


var_classsection = [h,b_top, b_bottom, tw, tf_top, tf_bottom,epsilon]
#class section for compression in Y




#class section for compression in Z


if Medy/Ned + Medz/Ned <= 0.05: # if moment arm is 0.05 of the section capacity, do check this value 
    classSection= classSection_I_Compression(var_set)
elif Ned/Medy + Ned/Medz <= 0.05 : # have to check this
    classSection = classSection_I_Moment(var_set)
else:
    classSection = classSection_I_Compression_Moment(var_set)





# shear Check
var_shear= [Vedy,Vedz, Av_y,Av_z, fy, gamma_M0, T] 


shearUtilisation_y= shearCheck(var_shear)[2]
shearUtilisation_z= shearCheck(var_shear)[3]

shearUtilisation = max(shearUtilisation_y ,shearUtilisation_z)

if shearUtilisation_y < 0.5 and shearUtilisation_z < 0.5:
    rho = 0
else:
    rho =  ((2*shearUtilisation) -1)**2 # does this make sense? (shear Utilization)
fy = (1-rho)*fy


# bending check
var_moment= [h,b_top, b_bottom, tw, tf_top, tf_bottom]



MRdy = Moment_check(var_moment)[0]
MRdz = Moment_check(var_moment)[1]


var_Axial = [Ned,Area,fy,Lb, Lb,gamma_M0, type]
# compression Check



Nrd = Axial_check(var_Axial)

# need to add second order effecrs for bending + axial



# bending-cpmpression reduction in bending capacity due to compression probably can igonore it, have to confirm with marco

#n = Ned/Nrd
#MnRd = Wpl*fyred*(1-math.pow(n,1.7))

if Ned>0:
    combine_Utilisation = abs(Ned)/Nrd
elif Ned <= 0:
    combine_Utilisation = abs(Ned)/Nrd + Medy/MRdy + Medz/MRdz



print("classSection: {}".format(classSection))
print("Ned/Nrd = {}".format(Ned/Nrd))
print("reduced yield strength= {}".format(fy))

print("Nrd: {} kN".format(round(Nrd/1000)))
print("VplRd: {} kN".format(round(shearUtilisation/1000)))
print("Mrdy: {} kNm".format(round(MRdy/1000000,2)))
print("Mrdz: {} kNm".format(round(MRdz/1000000,2)))
# ---------- end rhs_section ----------
uem_2 = UniaxialElasticMaterialAlpaca4d(E="2.01e11", v="0.30", rho="7850")  # -> out, uniAxialMaterial; same code as uem
# I- Section Capacity
panel = Panel(rhs_section.out)
# I- Section Capacity
panel_2 = Panel("150")
panel_3 = Panel(rhs_section.shearUtilisation)
panel_4 = Panel(rhs_section.combine_Utilisation)
is_2 = ISectionAlpaca4d(Bsup=panel_2, tsup="20", Binf=panel_2, tinf="20", H="150", tw="20", material=uem_2.uniAxialMaterial)  # -> Section; same code as is
number_slider_2 = Slider(50, range=0..100)
rhs_section_2 = GhPythonScript(
    Section=is_2,
    Lb="150",
    Ned="-154600",
    Vedy="200",
    Vedz="200",
    T="50",
    Medy="0",
    Medz="500",
    Lcry=number_slider_2,
    Lcrz=number_slider_2,
    type="0")  # -> out, combineUtilisation
# ---------- rhs_section_2: Python ----------
#section capacity check I-Section

import Rhino.Geometry as rg
import math

"""
input:
    Depth (h)-mm
    top flange width (b_top)-mm
    bottom flange width (b_bottom)-mm
    Web thickness (tw)-mm
    Top Flange thickness (tf_top)-mm
    Bottom flange Thickness (tf_bottom)-mm
    material properties
    gamma_M0

output:
    tensionUtilisation
    bendingUtilisation
"""

gamma_M0 = 1.0
gamma_M1 = 1.0
gamma_M2 = 1.1


upsilon = Section.material.v

E = Section.material.E
G = Section.material.G


# I need to define fy in the material properties class
fy =355 

eta = 1.2 if fy<= 460 else 1

h = Section.H
b_top = Section.Bsup
b_bottom = Section.Binf
tw = Section.tw
tf_top = Section.tsup
tf_bottom = Section.tinf


var_set= [h,b_top, b_bottom, tw, tf_top, tf_bottom]

if any(i<=0 for i in var_set):
  raise ValueError('Negative or zero value detected')
elif any (i<=3 for i in var_set) :
    raise ValueError('Thickness is less then 3 mm') 

Area = Section.Area()
#Area = (h*tw) + (b_top-tw)*tf_top + (b_bottom-tw)*tf_bottom
h_web = h-tf_bottom-tf_top #web height excluding flange thickness

A1= b_bottom*tf_bottom ; y1= tf_bottom/2  #bottom flaneg area
A2= (h-tf_bottom-tf_top)*tw ; y2= h/2     #web area
A3= b_top*tf_top ; y3= h/2- tf_top/2      #top flange area

cy_pos = (A1*y1 + A2*y2 + A3*y3)/(A1 + A2 + A3)
cy_neg = h - cy_pos

Iy1= b_bottom*tf_bottom**3/12; Iy2 = tw*(h-tf_bottom-tf_top)**3/12; Iy3 = b_top*tf_top**3/12   
Iy = Iy1 + A1*(cy_pos- y1) + Iy2 + A2*(cy_pos- y2) + Iy3 + A3*(cy_pos- y3)
Iz_web= (h-tf_bottom-tf_top)*tw**3/12
Iz = tf_bottom*b_bottom**3/12 + Iz_web + tf_top*b_top**3/12


alpham = [0.13, 0.21, 0.34, 0.49, 0.76]  #buckling curves
epsilon = math.sqrt(235/fy)


#Shear Area
Av_z = max(h*tw, eta*A2) #web max area
Av_y = A1 + A3   #flange area only

[Rx_0, Ry_0, Rz_0,Mxx_0, Myy_0, Rx_1, Ry_1, Rz_1,Mxx_1, Myy_1]= [1,1,1,1,1,1,1,1,1,1]

#Torsional property and checks
if T!=0: 
    h_web_T= h_web + (tf_bottom + tf_top)/2
    #h0 =2*((dy-t) + (dz-t))
    #Ah = (dy-t)*(dz-t)
    J= (b_bottom*tf_bottom**3 + b_top*tf_top**3 + h_web_T*tw**3)/3  #torsional constant
    Cw= h_web_T**2*tf_bottom*tf_top*b_bottom**3*b_top**3/(12*(tf_top*b_top**3 + tf_bottom*b_bottom**3))   #warping constant

    K_t = Lb*math.sqrt(G*J/(E*Cw))

    if [Mxx_0, Myy_0, Mxx_1, Myy_1] == [0,0,0,0] : #Mxx, Myy,MZZ end moment restrain; Rx,Ry,Rz = end translation restrain
        alpha_T = 3.7 ; beta_T = 1.08
    elif [Mxx_0, Myy_0, Mxx_1, Myy_1] == [1,1,1,1] :
        alpha_T = 6.9 ; beta_T = 1.14
    elif [Rx_0, Ry_0, Rz_0, Rx_1, Ry_1, Rz_1] == [0,0,0,1,1,1] or [Rx_0, Ry_0, Rz_0, Rx_1, Ry_1, Rz_1] == [1,1,1,0,0,0]:
        alpha_T = 2.7 ; beta_T = 1.11

    chi_torsion = 1/(beta_T + (alpha_T/K_t)**2)
    T_warp = T*(1-chi_torsion)
    T_vernant = T*chi_torsion
    
    #Trd= Cw*(fy/math.math.sqrt(3))/gamma_M0


var_classsection = [h,b_top, b_bottom, tw, tf_top, tf_bottom,epsilon]
#class section for compression in Y

def classSection_I_Compression(var_set):  
    c_web= h-tf_top- tf_bottom
    c_flange_top = (tf_top-tw)/2
    c_flange_bottom = (tf_bottom-tw)/2

    if (b_bottom != b_top) or (tf_top != tf_bottom):  #check if unsymmetrical I-section, considering elasric capacity always
        
        if (c_web/tw <= 42*epsilon) and (i<=14*epsilon for i in [c_flange_top/tf_top, c_flange_bottom/tf_bottom]) :
            classSection = 3
        else:
            raise ValueError('section unsymmetrical and in class 4')
    else:
        if c_web/tw <= 33 * epsilon and (i<=9*epsilon for i in [c_flange_top/tf_top,c_flange_bottom/tf_bottom]):
            classSection = 1
        elif c_web/tw <= 38 * epsilon and (i<=10*epsilon for i in [c_flange_top/tf_top,c_flange_bottom/tf_bottom]) :
            classSection = 2
        elif c_web/tw <= 42 * epsilon and (i<=14*epsilon for i in [c_flange_top/tf_top,c_flange_bottom/tf_bottom]):
            classSection = 3
        else:
            raise ValueError('section in class 4')
    
    return classSection


#class section for compression in Z
def classSection_I_Moment(var_set):  
    c_web= h-tf_top- tf_bottom
    c_flange_top = (tf_top-tw)/2
    c_flange_bottom = (tf_bottom-tw)/2

    if b_bottom != b_top or tf_top != tf_bottom:  #check if unsymmetrical I-section, considering elastic capacity always, check in with marco
        if c_web/tw <= 124*epsilon and (i<=14*epsilon for i in [c_flange_top/tf_top,c_flange_bottom/tf_bottom]):
            classSection=3
        else: 
            raise ValueError('section unsymmetrical and in class 4')

    else:
        if c_web/tw <= 72 * epsilon and (i<=9*epsilon for i in [c_flange_top/tf_top,c_flange_bottom/tf_bottom]):
            classSection = 1
        elif c_web/tw <= 83 * epsilon and (i<=10*epsilon for i in [c_flange_top/tf_top,c_flange_bottom/tf_bottom]):
         classSection = 2
        elif c_web/tw <= 124 * epsilon and (i<=14*epsilon for i in [c_flange_top/tf_top,c_flange_bottom/tf_bottom]):
            classSection = 3
        else:
            raise ValueError('section in class 4')
    return classSection

#class section for compression in Z
def classSection_I_Compression_Moment(var_set):  
    c_web= h-tf_top- tf_bottom
    c_flange_top = (tf_top-tw)/2
    c_flange_bottom = (tf_bottom-tw)/2

    alpha_local_web= 0.5*(1+ abs(Ned)/(fy*c_web*tw))
    alpha_local_flange_top= 0.5*(1+ abs(Ned)/(fy*c_flange_top*tf_top))    # check if c*tf is correct for area
    alpha_local_flange_bottom=0.5*(1+ abs(Ned)/(fy*c_flange_bottom*tf_bottom))

    psi_web= 2*Ned/(c_web*tw*fy) - 1
    psi_flange_top= 2*Ned/(c_flange_top*tf_top*fy) - 1
    psi_flange_bottom= 2*Ned/(c_flange_bottom*tf_bottom*fy) - 1

    if psi_flange_top == 1 :
        k_sigma_top= 0.43
    elif 0< psi_flange_top < 1 :
        k_sigma_top = 0.578/(psi_flange_top + 0.34)
    elif psi_flange_top == 0:
        k_sigma_top= 1.7
    elif -1< psi_flange_top< 0 :
        k_sigma_top = 1.7 - 5*psi_flange_top + 17.1*psi_flange_top**2
    elif psi_flange_top == -1 :
        k_sigma_top= 23.8
    

    if psi_flange_bottom == 1 :
        k_sigma_bottom= 0.43
    elif 0< psi_flange_bottom < 1 :
        k_sigma_bottom = 0.578/(psi_flange_bottom + 0.34)
    elif psi_flange_bottom == 0 :
        k_sigma_bottom= 1.7
    elif -1< psi_flange_bottom< 0 :
        k_sigma_bottom = 1.7 - 5*psi_flange_bottom + 17.1*psi_flange_bottom**2
    elif psi_flange_bottom == -1 :
        k_sigma_bottom= 23.8
    

    if alpha_local_web >0.5:
        class_1_limit= 396*epsilon/(13*alpha_local_web - 1)
        class_2_limit= 456*epsilon/(13*alpha_local_web - 1)
    else :
        class_1_limit= 36*epsilon/alpha_local_web
        class_2_limit= 41.5*epsilon/alpha_local_web

    if psi_web > -1:
        class_3_limit = 42*epsilon/(0.67 + 0.33*psi_web)
    else :
        class_3_limit= 62*epsilon*(1-psi_web)*math.sqrt(abs(psi_web))



    if b_bottom != b_top or tf_top != tf_bottom:  #check if unsymmetrical I-section, considering elasric capacity always
        if c_web/tw <= class_3_limit and c_flange_top/tf_top<= 21*epsilon*math.math.sqrt(k_sigma_top) and c_flange_bottom/tf_bottom<=21*epsilon*math.math.sqrt(k_sigma_bottom):
            classSection = 3
        else: 
           raise ValueError('section Unsymmetrical and in class 4') 
    else:
        if c_web/tw <= class_1_limit and c_flange_top/tf_top<=9*epsilon/alpha_local_flange_top and c_flange_bottom/tf_bottom<=9*epsilon/alpha_local_flange_bottom  :
            classSection = 1
        elif c_web/tw <= class_2_limit and c_flange_top/tf_top<=10*epsilon/alpha_local_flange_top and c_flange_bottom/tf_bottom<=10*epsilon/alpha_local_flange_bottom :
            classSection = 2
        elif c_web/tw <= class_3_limit and c_flange_top/tf_top<= 21*epsilon*math.math.sqrt(k_sigma_top) and c_flange_bottom/tf_bottom<=21*epsilon*math.math.sqrt(k_sigma_bottom) :
            classSection = 3
        else:
            raise ValueError('section in class 4')
    return classSection


if Medy/Ned + Medz/Ned <= 0.05: # if moment arm is 0.05 of the section capacity, do check this value 
    classSection= classSection_I_Compression(var_set)
elif Ned/Medy + Ned/Medz <= 0.05 : # have to check this
    classSection = classSection_I_Moment(var_set)
else:
    classSection = classSection_I_Compression_Moment(var_set)





# shear Check
var_shear= [Vedy,Vedz, Av_y,Av_z, fy, gamma_M0, T] 
def shearCheck(var_shear):
    if (h_web/tw > 72*epsilon/eta) :  #only applies for unstiffened webs, have to make an boolean toggle for this
        sigma_E = math.pi**2*E*tw**2/(12*(1-upsilon**2)*h_web**2)     #EN 1993-1-5 , A.1
        k_tau_st = max(9*(h_web/Lb)**2*math.pow(math.pow((Iz_web/tw**3*h_web), 3),1/4) , 2.1*math.pow(Iz_web/h_web,1/3)/tw, 1/3)    #Lb= a EN 1993-1-5 , A.3
        k_tau = 5.34 + 4*(h_web/Lb)**2 + k_tau_st # if a/h_web <=1 , else k_tau = 4 + 5.34*(h_web/Lb)**2 + k_tau_st - ignore for web without stiffner only
        lamda_w = 0.76*math.sqrt(fy/(k_tau*sigma_E))
        if lamda_w < 0.83/eta:   #1993-1-5 , 5.2
            chi_w = eta  
        elif 0.83/eta <= lamda_w < 1.08 :
            chi_w = 0.83/lamda_w
        else:
            chi_w = 1.37/(0.7 + lamda_w)
        
        VplRdy = chi_w*fy*h_web*tw/(math.sqrt(3)*gamma_M1)
    else: 
        VplRdy = (Av_y * (fy/math.sqrt(3)) )/gamma_M0
    
    VplRdz = (Av_z * (fy/math.sqrt(3)) ) / gamma_M0

    if T !=0 :
        tau_ed_web = T_vernant/tw  #shear stress due to torsion, where T is saint venant torsion
        tau_ed_flange = T_vernant/min(tf_bottom,tf_top)
    VplRdy = (1-(tau_ed_web/(fy/math.sqrt(3)/ gamma_M0)))*VplRdy
    VplRdz = (1-(tau_ed_flange/(fy/math.sqrt(3)/ gamma_M0)))*VplRdz
    shearUtilisation_y = Vedy/VplRdy # for combined shear in both direction
    shearUtilisation_z = Vedz/VplRdz
    
    return VplRdy, VplRdz, shearUtilisation_y, shearUtilisation_z

shearUtilisation_y= shearCheck(var_shear)[2]
shearUtilisation_z= shearCheck(var_shear)[3]


if shearUtilisation_y < 0.5 and shearUtilisation_z < 0.5:
    rho = 0
else:
    rho =  ((2*shearUtilisation) -1)**2 # does this make sense? (shear Utilization)
fy = (1-rho)*fy


# bending check
var_moment= [h,b_top, b_bottom, tw, tf_top, tf_bottom]

def Moment_check(var_set) :
    #section modulus check
    if classSection == 3:
        Wly = Iy/max(cy_pos, cy_neg) #elastic modulus y-y
        Wlz = Iz/max(b_top, b_bottom) #elastic modulus z-z
    elif classSection == 1 or 2 :
        Wly= (h-cy_neg-tf_bottom)**2*tw/2 + b_bottom*tf_bottom*(cy_pos-(tf_bottom/2))  #plastic modulus y-y
        Wlz = (A3*b_top+ A1*b_bottom)/4    #plastic modulus z-z
    else:
        raise valueerror('section in Class4, too slender')

    MRdy = Wly*fy/gamma_M0 
    MRdz = Wlz*fy/gamma_M0

    # 6.2.9 bending + axial
    Ncpr= (Area * fy) / gamma_M0 #compression plastic resistance

    if Ned > 0.25*Ncpr or Ned > 0.5*h_web*tw*fy/gamma_M0:
        n = Ned/Ncpr
        a= min((area - A1- A3)/area, 0.5)
        MRdy = min(MRdy*(1-n/(1- 0.5*a)), MRdy)
    elif Ned > h_web*tw*fy/gamma_M0:
        if n>a:
            MRdz = MRdz*(1- ((n-a)/(1-a))**2)
    
    Ma= 100 #bending moment at quater point have to get Ma,Mb,Mc value from opensees analysis
    Mb = 100 #bending moment at mid point
    Mc = 100 #bending moment at end point
    M_max = 100 #maximum bending moment on the member
    Cb = 12.5*M_max/(2.5*M_max + 3*Ma + 4*Mb + 3*Mc)  # shape factor based on bending diagram (AISC), only applies for moment in Y-Y

    #EN-1993-1-1 6.3.2.2
    k=1 ; k_w = 1  # end rotation factor ; end warping factor, have to include this going forward
    L_ltb = Lb ; k_ltb = 1 #length of unbraced member  # effective length factor for lateral torsional buckling, overriding L_ltb
    L_cr_ltb = L_ltb*k_ltb # effective critical length


    M_cr = Cb*math.pi**2*E*Iz*(math.sqrt((k*Cw/(k_w*Iz)) + (L_cr_ltb**2*G*J/(math.pi**2*E*Iz))))/L_cr_ltb**2  # , M_cr critical Bending moment
    Lamda_lt = math.sqrt(Wly*fy/M_cr)
    beta_lt = 0.75 #recommended value
    Lamda_lt_0 = 0.4 # recommended value

    if type==0 :
        if h/min(b_bottom,b_top) <= 2: #hot rolled sections
            alpha_lt = alpham[1]
        else:
            alpha_lt = alpham[2]
    if type== 1 :
        if h/min(b_bottom,b_top) <= 2:    #cold form section
            alpha_lt = alpham[3]
        else:
            alpha_lt = alpham[4]

    phi_lt = 0.5*(1 + alpha_lt*(Lamda_lt - Lamda_lt_0) + beta_lt*Lamda_lt**2)
    chi_lt = min(1/(phi_lt + math.sqrt(phi_lt**2 - beta_lt*Lamda_lt**2)), 1, 1/(Lamda_lt**2))

    if chi_lt <1:
         MRdy =chi_lt*MRdy

    return MRdy, MRdz 

MRdy = Moment_check(var_moment)[0]
MRdz = Moment_check(var_moment)[1]


var_Axial = [Ned,Area,fy,Lb, Lb,gamma_M0, type]
# compression Check

def Axial_check(var_Axial):

    NplRd = (Area * fy) / gamma_M0
    if Ned <=0 : # - indicates member in tension
        Nrd = NplRd    #require sign to be assigned to tesion force
    else:
        Ncpl =  NplRd
        k_cr_y = 1 ; k_cr_z = 1 ; Lcry= k_cr_y*Lb ; Lcrz= k_cr_z*Lb # k_cr is effective length factor in respective direction

        Ncry = math.pi**2*E*Iy/Lcry**2   #euler critical buckling y direction
        Ncrz = math.pi**2*E*Iz/Lcrz**2   #euler critical buckling z direction
        Lamda_y = math.math.sqrt((Area*fy)/Ncry) ; Lamda_z = math.math.sqrt((Area*fy)/Ncrz) #slenderness ratio
        if type == 0 : #0= hot rolled, 1= cold formed
            if h/min(b_bottom, b_top) >1.2:
                if min(tf_bottom, tf_top) <= 40: #mm:
                    if fy>420: #Mpa:
                        alpha_y = alpham[0] 
                        alpha_z = alpham[0]
                    else:
                        alpha_y = alpham[1] 
                        alpha_z = alpham[2]
                elif 40< min(tf_bottom, tf_top) <= 100 : #mm
                    if fy>420: #Mpa:
                        alpha_y = alpham[1] 
                        alpha_z = alpham[1]
                    else:
                        alpha_y = alpham[2] 
                        alpha_z = alpham[3]
                else:
                    raise ValueError('flange thickness out of limits')
            
            else:
                if min(tf_bottom, tf_top) <= 100 :  #mm:
                    if fy>420: #Mpa:
                        alpha_y = alpham[1] 
                        alpha_z = alpham[1]
                    else:
                        alpha_y = alpham[2] 
                        alpha_z = alpham[3]
                elif  min(tf_bottom, tf_top) >100 : #mm
                    if fy>420: #Mpa:
                        alpha_y = alpham[3] 
                        alpha_z = alpham[3]
                    else:
                        alpha_y = alpham[4] 
                        alpha_z = alpham[4]
                else:
                    raise ValueError('flange thickness out of limits')    
        elif type == 1 :
            if min(tf_bottom, tf_top) <= 40 : #mm:
                alpha_y = alpham[2] 
                alpha_z = alpham[3]
            else:
                alpha_y = alpham[3] 
                alpha_z = alpham[4]

        phi_y= 0.5*(1 + alpha_y*(Lamda_y - 0.2) + Lamda_y**2) 
        phi_z= 0.5*(1 + alpha_z*(Lamda_z - 0.2) + Lamda_z**2)
        chi_yy = 1/(phi_y+ math.sqrt(phi_yy**2 - Lamda_y**2))
        chi_zz = 1/(phi_z+ math.sqrt(phi_zz**2 - Lamda_z**2))

        Nbrd_y= chi_yy*Ncpl ; Nbrd_z= chi_zz*Ncpl
        Nbrd = min(Nbrd_y, Nbrd_z)
        Nrd= min(Ncpl, Nbrd)
    return Nrd

Nrd = Axial_check(var_Axial)

# need to add second order effecrs for bending + axial



# bending-cpmpression reduction in bending capacity due to compression probably can igonore it, have to confirm with marco

#n = Ned/Nrd
#MnRd = Wpl*fyred*(1-math.pow(n,1.7))

if Ned>0:
    combine_Utilisation = abs(Ned)/Nrd
elif Ned <= 0:
    combine_Utilisation = abs(Ned)/Nrd + Medy/MRdy + Medz/MRdz
print(combine_Utilisation)

shearUtilisation = max(shearUtilisation_y ,shearUtilisation_z)

print("classSection: {}".format(classSection))
print("Ned/Nrd = {}".format(Ned/Nrd))
print("reduced yield strength= {}".format(fy))

print("Nrd: {} kN".format(round(Nrd/1000)))
print("VplRd: {} kN".format(round(shearUtilisation/1000)))
print("Mrdy: {} kNm".format(round(MRdy/1000000,2)))
print("Mrdz: {} kNm".format(round(MRdz/1000000,2)))
# ---------- end rhs_section_2 ----------
panel_5 = Panel(rhs_section_2.out)
panel_6 = Panel(rhs_section_2.combineUtilisation)
