# Grasshopper definition timberDesign.gh (Grasshopper 1.0.7)

value_list = ValueList({"C14", "C16", "C18", "C20", "C22", "C24"}, selected="C14")
tp = TimberPropertiesC14Alpaca4d(TimberClass=value_list)  # -> out, timber_attributes
# ---------- tp: Python ----------
"""
Create a uniaxial Elastic Material
-
    Args:
        E:
        Eneg:
        eta:
        G:
        v:
        rho:
    Returns:
        uniAxialMaterial:
"""


import os
import sys
import Rhino.Geometry as rg
import Grasshopper as gh
import copy
import json



ghenv.Component.Name = "Timber Properties {} (Alpaca4d)".format(TimberClass)
ghenv.Component.NickName = 'TP'
ghenv.Component.Message = "Timber Properties {} (Alpaca4d)".format(TimberClass)




## add alpaca install directory to system path

ghcompfolder = gh.Folders.DefaultAssemblyFolder
if ghcompfolder not in sys.path:
    sys.path.append(ghcompfolder)

try:
    from Alpaca4d import alpaca4d as alpaca
except:
    msg = "Cannot import Alpaca4d. Is the Alpaca4d folder available in " + ghcompfolder + "?"
    ghenv.Component.AddRuntimeMessage(gh.Kernel.GH_RuntimeMessageLevel.Error, msg)


timber_library = os.path.join(ghcompfolder,'Alpaca4d/Material/timber_properties.json')


class Struct:
    def __init__(self, **entries):
        self.__dict__.update(entries)
    
    def __repr__(self):
        return str(self.__dict__)




# Opening JSON 
with open(timber_library, 'r') as json_file:
    timber_properties = json.load(json_file)



if fc_0_k:
    timber_properties[TimberClass]['fc_0_k'] = fc_0_k
if fm_k:
    timber_properties[TimberClass]['fm_k'] = fm_k
if fc_90_k:
    timber_properties[TimberClass]['fc_90_k'] = fc_90_k
if ft_0_k:
    timber_properties[TimberClass]['ft_0_k'] = ft_0_k
if ft_90_k:
    timber_properties[TimberClass]['ft_90_k'] = ft_90_k
if fv_k:
    timber_properties[TimberClass]['fv_k'] = fv_k

if E0_05:
    timber_properties[TimberClass]['E0_05'] = E0_05
if G_Mean:
    timber_properties[TimberClass]['G_Mean'] = G_Mean

timber_properties[TimberClass]['name'] = TimberClass
timber_properties[TimberClass]['material_type'] = 'timber'




for k,v in timber_properties[TimberClass].items():
    print("{}: {}".format(k,v))



timber_attributes = Struct(**timber_properties[TimberClass])
# ---------- end tp ----------

uem = UniaxialElasticMaterialAlpaca4d(E="210000", v="0.30", rho="400", attributes=tp.timber_attributes)  # -> out, uniAxialMaterial
# ---------- uem: Python ----------
"""
Create a uniaxial Elastic Material
-
    Args:
        E:
        Eneg:
        eta:
        G:
        v:
        rho:
    Returns:
        uniAxialMaterial:
"""

ghenv.Component.Name = "uniaxial Elastic Material (Alpaca4d)"
ghenv.Component.NickName = 'UEM'
ghenv.Component.Message = "uniaxial Elastic (Alpaca4d)"

import sys
import Rhino.Geometry as rg
import Grasshopper as gh
import copy


## add alpaca install directory to system path

ghcompfolder = gh.Folders.DefaultAssemblyFolder
if ghcompfolder not in sys.path:
    sys.path.append(ghcompfolder)

try:
    from Alpaca4d import alpaca4d as alpaca
except:
    msg = "Cannot import Alpaca4d. Is the Alpaca4d folder available in " + ghcompfolder + "?"
    ghenv.Component.AddRuntimeMessage(gh.Kernel.GH_RuntimeMessageLevel.Error, msg)


checkData = True

if not E:
    checkData = False
    msg = "Input parameter E failed to collect data"
    ghenv.Component.AddRuntimeMessage(gh.Kernel.GH_RuntimeMessageLevel.Warning, msg)

if not G and not v:
    checkData = False
    msg = "Input parameter G or v failed to collect data"
    ghenv.Component.AddRuntimeMessage(gh.Kernel.GH_RuntimeMessageLevel.Warning, msg)

if not rho:
    checkData = False
    msg = "Input parameter rho failed to collect data"
    ghenv.Component.AddRuntimeMessage(gh.Kernel.GH_RuntimeMessageLevel.Warning, msg)



if checkData:
    uniAxialMaterial = alpaca.uniAxialMaterialElastic(name, E, Eneg, eta, G, v, rho, attributes)
# ---------- end uem ----------
ghpython_script = GhPythonScript()  # -> out, timber_properties
# ---------- ghpython_script: Python ----------
import sys
import Rhino.Geometry as rg
import Grasshopper as gh
import copy


## add alpaca install directory to system path

ghcompfolder = gh.Folders.DefaultAssemblyFolder
if ghcompfolder not in sys.path:
    sys.path.append(ghcompfolder)

try:
    from Alpaca4d import alpaca4d as alpaca
except:
    msg = "Cannot import Alpaca4d. Is the Alpaca4d folder available in " + ghcompfolder + "?"
    ghenv.Component.AddRuntimeMessage(gh.Kernel.GH_RuntimeMessageLevel.Error, msg)



# importing the module
import json
from Alpaca4d.bunch import Bunch

# Opening JSON file
with open(r"C:\Users\Marco\Desktop\timber_properties.json", 'r') as json_file:
    timberProperties = json.load(json_file)


timber_properties = timberProperties[Timber_Class]


for k,v in timber_properties.items():
    print("{}: {}".format(k,v))
# ---------- end ghpython_script ----------
panel = Panel(ghpython_script.out)
rs = RectangularSectionAlpaca4d(b="10", h="50", material=uem.uniAxialMaterial)  # -> out, Section
# ---------- rs: Python ----------
"""
Create a Rectangular Cross Section
-
    Args:
        secName:
        Area:
        Izz:
        Iyy:
        J:
        alphaY:
        alphaZ:
        material:
    Returns:
        Section:
"""
ghenv.Component.Name = "Rectangular Section (Alpaca4d)"
ghenv.Component.NickName = 'RS'
ghenv.Component.Message = "Rectangular Section (Alpaca4d)"

import sys
import Rhino.Geometry as rg
import Grasshopper as gh
import copy


## add alpaca install directory to system path

ghcompfolder = gh.Folders.DefaultAssemblyFolder
if ghcompfolder not in sys.path:
    sys.path.append(ghcompfolder)

try:
    from Alpaca4d import alpaca4d as alpaca
except:
    msg = "Cannot import Alpaca4d. Is the Alpaca4d folder available in " + ghcompfolder + "?"
    ghenv.Component.AddRuntimeMessage(gh.Kernel.GH_RuntimeMessageLevel.Error, msg)


checkData = True

if not b:
    checkData = False
    msg = "Input parameter b failed to collect data"
    ghenv.Component.AddRuntimeMessage(gh.Kernel.GH_RuntimeMessageLevel.Warning, msg)

if not h:
    checkData = False
    msg = "Input parameter h failed to collect data"
    ghenv.Component.AddRuntimeMessage(gh.Kernel.GH_RuntimeMessageLevel.Warning, msg)

if not material:
    checkData = False
    msg = "Input parameter material failed to collect data"
    ghenv.Component.AddRuntimeMessage(gh.Kernel.GH_RuntimeMessageLevel.Warning, msg)



if checkData:
    Section = alpaca.RectangularCS(secName, b,h,material)
# ---------- end rs ----------
crv = Curve(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)
python = GhPythonScript(Buckling_Length_Y="6000", Buckling_Length_Y_2="3500")  # -> out, a
# ---------- python: Python ----------
a = 0
# ---------- end python ----------
fbc = ForceBeamColumnAlpaca4d(Line=crv, Section=rs.Section, attributes=python.a)  # -> out, Element; inputs Line: Curve, Colour: Color, Z_Axis: Vector3d
# ---------- fbc: Python ----------
"""
Create a Force Beam Column
-
    Args:
        Line:
        Section:
        Colour:
        Z_Axis:
    Returns:
        Element:
"""

ghenv.Component.Name = "Force Beam Column (Alpaca4d)"
ghenv.Component.NickName = 'FBC'
ghenv.Component.Message = "Force Beam Column (Alpaca4d)"


import sys
import Rhino.Geometry as rg
import Grasshopper as gh
import ghpythonlib.components as ghcomp
from System.Drawing import Color

## add alpaca install directory to system path

ghcompfolder = gh.Folders.DefaultAssemblyFolder
if ghcompfolder not in sys.path:
    sys.path.append(ghcompfolder)

try:
    from Alpaca4d import alpaca4d as alpaca
except:
    msg = "Cannot import Alpaca4d. Is the Alpaca4d folder available in " + ghcompfolder + "?"
    ghenv.Component.AddRuntimeMessage(gh.Kernel.GH_RuntimeMessageLevel.Error, msg)


checkData = True

if not Line:
    checkData = False
    msg = "Input parameter Line failed to collect data"
    ghenv.Component.AddRuntimeMessage(gh.Kernel.GH_RuntimeMessageLevel.Warning, msg)


if not Section:
    checkData = False
    msg = "Input parameter Section failed to collect data"
    ghenv.Component.AddRuntimeMessage(gh.Kernel.GH_RuntimeMessageLevel.Warning, msg)

if not Colour:
    Colour = Color.Red


if not GeomTransf:
    GeomTransf = "Linear"

if checkData:
    
    if not Z_Axis:
        midPoint =  Line.PointAtNormalizedLength(0.5)
        parameter = Line.ClosestPoint(midPoint, 0.01)[1]
        Z_Axis = ghcomp.PerpFrame( Line, parameter )
    Element = alpaca.ForceBeamColumn(Line, Section, GeomTransf, Colour, Z_Axis)
# ---------- end fbc ----------
panel_2 = Panel("""-65.8
0
0.3
0
0.5
0.0""")
bf = BeamForcesAlpaca4d(History=False)  # -> out, N, T2, T3, M1, M2, M3; inputs History: Boolean, step: Int32
# ---------- bf: Python ----------
"""
Read Beam Forces

    Args:
        AlpacaModel:
        History:
        step:
    Returns:
        N: forces in direction 3  (Axial Force)
        M2: Moments around axis 2 (Bending Moment 1)
        T1: forces in direction 1 (Shear Force 1)
        M1: Moments around axis 1 (Bending Moment 2)
        T2: forces in direction 2 (Shear Force 2)
        Mt: Moments around axis 3 (Twisting Moment)
"""

import sys
import os
import System
from System.Drawing import Color
import clr
import clrtype
import Rhino.Geometry as rg
import rhinoscriptsyntax as rs
import Grasshopper as gh
import copy
import ghpythonlib.treehelpers as th


ghenv.Component.Name = "Beam Forces (Alpaca4d)"
ghenv.Component.NickName = 'BF'
ghenv.Component.Message = "Beam Forces (Alpaca4d)"
## add alpaca install directory to system path

ghcompfolder = gh.Folders.DefaultAssemblyFolder
if ghcompfolder not in sys.path:
    sys.path.append(ghcompfolder)

try:
    from Alpaca4d import alpaca4d as alpaca
except:
    msg = "Cannot import Alpaca4d. Is the Alpaca4d folder available in " + ghcompfolder + "?"
    ghenv.Component.AddRuntimeMessage(gh.Kernel.GH_RuntimeMessageLevel.Error, msg)



FolderPath = rs.DocumentPath()
os.chdir(FolderPath)


# import costum modules to read the hdf5 file

my_module_name = "Alpaca_StepReader"
my_module = sys.modules.setdefault(my_module_name, type(sys)(my_module_name))

hdfFilePath = os.path.join(ghcompfolder, "Alpaca4d\HDF5CSharp.dll")
clr.AddReferenceToFileAndPath(hdfFilePath)

from HDF5CSharp import Hdf5

try:
    Steps = my_module.Steps
except AttributeError:
    type_2d = type(System.Array.CreateInstance(float, 1, 1))

    class Steps(object):
        __metaclass__ = clrtype.ClrClass
        _clrfields = {"STEP_{}".format(i): type_2d for i in range(1000)} # it will work for model with less than 1000 steps

    my_module.Steps = Steps


checkData = True

if not AlpacaModel:
    checkData = False
    msg = "Input parameter AlpacaModel failed to collect data"
    ghenv.Component.AddRuntimeMessage(gh.Kernel.GH_RuntimeMessageLevel.Warning, msg)

if checkData:
    
    step = (int(AlpacaModel.analysis.AnalysisSteps.numIncr) - 1) if step is None else step
    
    N = []
    T1 = []
    T2 = []
    M1 = []
    M2 = []
    Mz = []
    
    fileId = Hdf5.OpenFile(AlpacaModel.recorderName, True)
    
    stressResult = Hdf5.ReadObject[Steps](fileId, "/MODEL_STAGE[1]/RESULTS/ON_ELEMENTS/section.force/74-ForceBeamColumn3d[1000:1:0]/DATA")
    if History is True:
        try:
            maxNumberStep = int(AlpacaModel.analysis.AnalysisSteps.numIncr)
        
        
            for i,item in enumerate(AlpacaModel.beams):
                
                Ni = []
                M2i = []
                T1i = []
                
                M1i = []
                T2i = []
                Mzi = []
                
                for istep in range(maxNumberStep):
                
                    ni = 5 # potrebbe cambiare per ogni trave
                    Ni.append([getattr(stressResult, 'STEP_{}'.format(istep))[i,j] for j in range(0,ni*6, 6)])
                    M2i.append([ getattr(stressResult, 'STEP_{}'.format(istep))[i,j] for j in range(1,ni*6, 6)])
                    T1i.append([ getattr(stressResult, 'STEP_{}'.format(istep))[i,j] for j in range(2,ni*6, 6)])
                    M1i.append([ getattr(stressResult, 'STEP_{}'.format(istep))[i,j] for j in range(3,ni*6, 6)])
                    T2i.append([ getattr(stressResult, 'STEP_{}'.format(istep))[i,j] for j in range(4,ni*6, 6)])
                    Mzi.append([ getattr(stressResult, 'STEP_{}'.format(istep))[i,j] for j in range(5,ni*6, 6)])
                
                N.append([Ni])
                M2.append([M2i])
                T1.append([T1i])
                M1.append([M1i])
                T2.append([T2i])
                Mz.append([Mzi])
            Hdf5.CloseFile(fileId)
            print("I have closed the file")
        except:
            Hdf5.CloseFile(fileId)
            print("I have closed the file")
    elif History == False:
        try:
            for i,item in enumerate(AlpacaModel.beams):
                ni = 5 # potrebbe cambiare per ogni trave
                Ni = [ getattr(stressResult, 'STEP_{}'.format(step))[i,j] for j in range(0,ni*6, 6)]
                M2i = [ getattr(stressResult, 'STEP_{}'.format(step))[i,j] for j in range(1,ni*6, 6)]  
                T1i = [ getattr(stressResult, 'STEP_{}'.format(step))[i,j] for j in range(2,ni*6, 6)]
                M1i = [ getattr(stressResult, 'STEP_{}'.format(step))[i,j] for j in range(3,ni*6, 6)]
                T2i = [ getattr(stressResult, 'STEP_{}'.format(step))[i,j] for j in range(4,ni*6, 6)]
                Mzi = [ getattr(stressResult, 'STEP_{}'.format(step))[i,j] for j in range(5,ni*6, 6)]
                
                N.append([Ni])
                M2.append([M2i])
                T1.append([T1i])
                M1.append([M1i])
                T2.append([T2i])
                Mz.append([Mzi])
            
            Hdf5.CloseFile(fileId)
            print("I have closed the file")
        
        except:
            Hdf5.CloseFile(fileId)
            print("I have closed the file")
    
    
    
    N = th.list_to_tree(N)
    M2 = th.list_to_tree(M2)
    T1 = th.list_to_tree(T1)
    M1 = th.list_to_tree(M1)
    T2 = th.list_to_tree(T2)
    Mz = th.list_to_tree(Mz)
# ---------- end bf ----------
item = ListItem(List=panel_2, Index=0, Wrap=True)  # -> Item, Item1, Item2, Item3, Item4, Item5
timber_class = ValueList({"GOB_Green_Oak", "C14", "C16", "C18", "C20", "C22", "C24", "C27", "C30"}, selected="C14")
duration = ValueList({"permanent", "long_term", "medium_term", "short_term", "instantaneous"}, selected="instantaneous")
knm_to_nmm = Number(expr("x*1000000", item.Item3))
knm_to_nmm_2 = Number(expr("x*1000000", item.Item4))
knm_to_nmm_3 = Number(expr("x*1000000", item.Item5))
python_2 = GhPythonScript(Element=fbc.Element)  # -> base, height
# ---------- python_2: Python ----------
base = Element.CrossSection.b
height = Element.CrossSection.h
# ---------- end python_2 ----------
kn_to_n = Number(expr("x*1000", item.Item))
kn_to_n_2 = Number(expr("x*1000", item.Item2))
service_class = ValueList({"1", "2", "3"}, selected="2")
kn_to_n_3 = Number(expr("x*1000", item.Item1))
knm_to_nmm_4 = Number(expr("x*1000000", bf.M3))
knm_to_nmm_5 = Number(expr("x*1000000", bf.M1))
knm_to_nmm_6 = Number(expr("x*1000000", bf.M2))
kn_to_n_4 = Number(expr("x*1000", bf.T2))
kn_to_n_5 = Number(expr("x*1000", bf.N))
kn_to_n_6 = Number(expr("x*1000", bf.T3))
timber_class_2 = ValueList({"GOB_Green_Oak", "C14", "C16", "C18", "C20", "C22", "C24", "C27", "C30"}, selected="C14")
duration_2 = ValueList({"permanent", "long_term", "medium_term", "short_term", "instantaneous"}, selected="instantaneous")
service_class_2 = ValueList({"1", "2", "3"}, selected="2")
knm_to_nmm_7 = Number(expr("x*1000000", "0.0"))
knm_to_nmm_8 = Number(expr("x*1000000", "-10"))
knm_to_nmm_9 = Number(expr("x*1000000", "0.0"))
kn_to_n_7 = Number(expr("x*1000", "-10"))
kn_to_n_8 = Number(expr("x*1000", "0.0"))
kn_to_n_9 = Number(expr("x*1000", "0.0"))
tc = TimberCheckAlpaca4d(
    BeamElement=fbc.Element,
    b=python_2.base,
    h=python_2.height,
    L_ey="2850",
    L_ez="3810",
    Timber_Class=timber_class,
    service_class=service_class,
    duration=duration,
    N_x=kn_to_n,
    V_y=kn_to_n_3,
    V_z=kn_to_n_2,
    M_x=knm_to_nmm,
    M_y=knm_to_nmm_2,
    M_z=knm_to_nmm_3)  # -> out, util_axial, util_bending_y, util_bending_z, util_shear, util_bending_tens_y, util_bending_tens_z, util_bending_comp_y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
# ---------- tc: Python ----------
import math
import json
import os

import sys
import Rhino.Geometry as rg
import Grasshopper as gh


ghenv.Component.Name = "Timber Check (Alpaca4d)"
ghenv.Component.NickName = 'TC'
ghenv.Component.Message = "Timber Check (Alpaca4d)"



## add alpaca install directory to system path

ghcompfolder = gh.Folders.DefaultAssemblyFolder
if ghcompfolder not in sys.path:
    sys.path.append(ghcompfolder)

try:
    from Alpaca4d import alpaca4d as alpaca
except:
    msg = "Cannot import Alpaca4d. Is the Alpaca4d folder available in " + ghcompfolder + "?"
    ghenv.Component.AddRuntimeMessage(gh.Kernel.GH_RuntimeMessageLevel.Error, msg)


# reference value in [N/mm2]

# Input [mm]

# b = 75
# h = 15

# L_ey = 1000
# L_ez = 1000


# Timber_Class = "C22"
# service_class = 1
# duration = "instantaneous"

# # Units [N]

# N_x = -4000
# V_y = 1000
# V_z = 1000
# M_x = 1000
# M_y = 100000
# M_z = 100000



# Opening JSON
def load_timber_properties(folder_path):

    collected_properties = []

    properties = ['timber_properties.json','k_mod.json','safety_factor.json','straightness_factor.json']

    for properti in properties:

        file_path = os.path.join(folder_path, properti)
        with open(file_path, 'r') as json_file:
            collected_properties.append(json.load(json_file))
    
    timber_properties, k_mod, safety_factor, straightness_factor = collected_properties

    return timber_properties, k_mod, safety_factor, straightness_factor


# Section Properties
def section_properties(b, h):

        Area = b * h

        W_y = (b * h**2) / 6
        W_z = (b**2 * h) / 6

        I_y = (b * h**3) / 12
        I_z = (b**3 * h) / 12

        I_t = 1/3 * b**3 * h * (1-0.63*(b/h))

        radii_of_gyration_y = (I_y/Area)**0.5
        radii_of_gyration_z = (I_z/Area)**0.5

        return Area, W_y, W_z, I_y, I_z, I_t, radii_of_gyration_y, radii_of_gyration_z


# Material Properties
def material_properties(timber_properties, Timber_Class):

        material_type = timber_properties[Timber_Class]["type"]
        fm_k = timber_properties[Timber_Class]["fm_k"]
        fv_k = timber_properties[Timber_Class]["fv_k"]
        fc_0_k = timber_properties[Timber_Class]["fc_0_k"]
        ft_0_k = timber_properties[Timber_Class]['ft_0_k']
        E_mean = timber_properties[Timber_Class]["E_mean"]
        E0_05 = timber_properties[Timber_Class]["E0_05"]
        G_mean = timber_properties[Timber_Class]["G_mean"]
        G0_05 = E0_05/16

        return material_type, fm_k, fv_k, fc_0_k, ft_0_k, E_mean, E0_05, G_mean, G0_05



# Design Factor
def design_parameters(b, h, safety_factor, material_type, k_mod, service_class, duration):

    km = 0.70
    gamma_m = safety_factor[material_type]
    kmod = k_mod[material_type][service_class][duration]

    print("kmod: {0:.2f}".format(kmod))


    ky_h = min( (150/h)**0.2 , 1.3 )
    kz_h = min( (150/b)**0.2 , 1.3 )

    ky_h = 1.0 if ky_h < 1.0 else ky_h
    kz_h = 1.0 if kz_h < 1.0 else kz_h

    print("ky_h: {0:.2f}".format(ky_h))
    print("kz_h: {0:.2f}".format(kz_h))


    kh = min(ky_h,kz_h)

    print("kh: {0:.2f}".format(kh))

    return km, gamma_m , kmod, ky_h, kz_h, kh


def buckling_parameters(b, h, L_ey, L_ez, radii_of_gyration_y, radii_of_gyration_z, fm_k, fc_0_k, E0_05, straightness_factor, material_type):
    

    lambda_y = L_ey / radii_of_gyration_y
    lambda_z = L_ez / radii_of_gyration_z

    print("lambda_y: {0:.2f}".format(lambda_y))
    print("lambda_z: {0:.2f}".format(lambda_z))


    lambda_rel_y = (lambda_y/math.pi) * (fc_0_k/E0_05)**0.5
    lambda_rel_z = (lambda_z/math.pi) * (fc_0_k/E0_05)**0.5

    print("lambda_rel_y: {0:.2f}".format(lambda_rel_y))
    print("lambda_rel_z: {0:.2f}".format(lambda_rel_z))


    beta_c = straightness_factor[material_type]

    k_y = 0.5 * (1 + beta_c * (lambda_rel_y - 0.3) + lambda_rel_y**2)
    k_z = 0.5 * (1 + beta_c * (lambda_rel_z - 0.3) + lambda_rel_z**2)

    print("k_y: {0:.2f}".format(k_y))
    print("k_z: {0:.2f}".format(k_z))


    kc_y = 1 / (k_y + math.sqrt(k_y**2 - lambda_rel_y**2))
    kc_z = 1 / (k_z + math.sqrt(k_z**2 - lambda_rel_z**2))

    print("kc_y: {0:.2f}".format(kc_y))
    print("kc_z: {0:.2f}".format(kc_z))


    kc = min(kc_y,kc_z)

    print("kc: {0:.2f}".format(kc))


    sigma_m_crit_y = E0_05 * (0.78 * b**2) / (h * L_ey)
    lambda_rel_m_y = math.sqrt(fm_k/sigma_m_crit_y)

    sigma_m_crit_z = E0_05 * (0.78 * h**2) / (b * L_ez)
    lambda_rel_m_z = math.sqrt(fm_k/sigma_m_crit_z)


    print("sigma_m_crit_y: {0:.2f}".format(sigma_m_crit_y))
    print("lambda_rel_m_y: {0:.2f}".format(lambda_rel_m_y))
    print("sigma_m_crit_z: {0:.2f}".format(sigma_m_crit_z))
    print("lambda_rel_m_z: {0:.2f}".format(lambda_rel_m_z))


    if lambda_rel_m_y < 0.75:
            k_crit_y = 1.00
    elif lambda_rel_m_y <= 1.40:
            k_crit_y = 1.56-0.75*lambda_rel_m_y
    elif lambda_rel_m_y > 1.40:
            k_crit_y = 1/lambda_rel_m_y**2


    if lambda_rel_m_z < 0.75:
            k_crit_z = 1.00
    elif lambda_rel_m_z <= 1.40:
            k_crit_z = 1.56-0.75*lambda_rel_m_z
    elif lambda_rel_m_z > 1.40:
            k_crit_z = 1/lambda_rel_m_z**2

    print("k_crit_y: {0:.2f}".format(k_crit_y))
    print("k_crit_z: {0:.2f}".format(k_crit_z))
    print("\n")

    return kc_y, kc_z, kc, k_crit_y, k_crit_z



# Design Strength

def axial_stress(N_x, Area):
    if N_x < 0.00:
            sigma_c_0_d = abs(N_x) / Area
            sigma_t_0_d = 0.00
            print("sigma_c_0_d: {0:.2f}".format(sigma_c_0_d))
            print("sigma_t_0_d: {0:.2f}".format(sigma_t_0_d))
    elif N_x > 0.00:
            sigma_c_0_d = 0.00
            sigma_t_0_d = abs(N_x) / Area
            print("sigma_c_0_d: {0:.2f}".format(sigma_c_0_d))
            print("sigma_t_0_d: {0:.2f}".format(sigma_t_0_d))
    else:
            sigma_c_0_d = 0.00
            sigma_t_0_d = 0.00
            print("sigma_c_0_d: {0:.2f}".format(sigma_c_0_d))
            print("sigma_t_0_d: {0:.2f}".format(sigma_t_0_d))
    
    return sigma_c_0_d, sigma_t_0_d


def bending_stress(M_y, M_z, W_y, W_z):
    
    sigma_m_y_d = abs(M_y) / W_y
    sigma_m_z_d = abs(M_z) / W_z
    
    print("sigma_m_y_d: {0:.2f}".format(sigma_m_y_d))
    print("sigma_m_z_d: {0:.2f}".format(sigma_m_z_d))

    return sigma_m_y_d, sigma_m_z_d


def shear_stress(V_y, V_z, b, h):

    k_cr = 0.67
    Area_eff = b * k_cr * h
    tau_y_d = 1.5 * abs(V_y) / Area_eff
    tau_z_d = 1.5 * abs(V_z) / Area_eff

    tau_d = math.sqrt(tau_y_d**2 + tau_z_d**2)

    print("tau_y_d: {0:.2f}".format(tau_y_d))
    print("tau_z_d: {0:.2f}".format(tau_z_d))
    print("tau_d: {0:.2f}".format(tau_d))

    return tau_d


def axial_resistance(kmod, fc_0_k, ft_0_k, gamma_m):

    fc_0_d = kmod * fc_0_k / gamma_m
    ft_0_d = kh * kmod * ft_0_k / gamma_m

    print("fc_0_d: {0:.2f}".format(fc_0_d))
    print("ft_0_d: {0:.2f}".format(ft_0_d))

    return fc_0_d, ft_0_d


def bending_resistance(kmod, ky_h, kz_h, fm_k, gamma_m):

    fm_y_d = kmod * ky_h * fm_k / gamma_m
    fm_z_d = kmod * kz_h * fm_k / gamma_m

    print("fm_y_d: {0:.2f}".format(fm_y_d))
    print("fm_z_d: {0:.2f}".format(fm_z_d))
    return fm_y_d, fm_z_d


def shear_resistance(kmod, fv_k, gamma_m):

    fv_d = kmod * fv_k / gamma_m
    print("fv_d: {0:.2f}".format(fv_d))

    return fv_d



# Design Combination

def utilisation_axial(sigma_c_0_d, sigma_t_0_d, ft_0_d, fc_0_d, kc):
    
    util_axial_tens = sigma_t_0_d/ft_0_d
    util_axial_comp = abs(sigma_c_0_d/(kc*fc_0_d))
    util_axial = max(util_axial_tens,util_axial_comp)

    return util_axial_tens, util_axial_comp, util_axial


def utilisation_bending(sigma_m_y_d, sigma_m_z_d, fm_y_d, fm_z_d, km):

    util_bending_y_1 = sigma_m_y_d/fm_y_d
    util_bending_y_2 = km * sigma_m_y_d/fm_y_d

    util_bending_z_1 = sigma_m_z_d/fm_z_d
    util_bending_z_2 = km * sigma_m_z_d/fm_z_d

    util_bending_y = max(util_bending_y_1,util_bending_y_2)
    util_bending_z = max(util_bending_z_1,util_bending_z_2)

    return util_bending_y, util_bending_z

def utilisation_shear(tau_d, fv_d):

    util_shear = tau_d/fv_d

    return util_shear


def utilisation_tension_bending(sigma_t_0_d, ft_0_d, sigma_m_y_d, fm_y_d, sigma_m_z_d, fm_z_d, km):
    
    util_bending_tens_y = (sigma_t_0_d/ft_0_d) + (sigma_m_y_d/fm_y_d) + km * (sigma_m_z_d/fm_z_d)
    util_bending_tens_z = (sigma_t_0_d/ft_0_d) + km * (sigma_m_y_d/fm_y_d) + (sigma_m_z_d/fm_z_d)

    return util_bending_tens_y, util_bending_tens_z


def utilisation_compression_bending(sigma_c_0_d, fc_0_d, sigma_m_y_d, fm_y_d, sigma_m_z_d, fm_z_d, kc_y, kc_z, km):

    util_bending_comp_y_1 = (abs(sigma_c_0_d)/(kc_y * fc_0_d)) + (sigma_m_y_d/fm_y_d) + km * (sigma_m_z_d/fm_z_d)
    util_bending_comp_y_2 = (abs(sigma_c_0_d)/(fc_0_d))**2 + (sigma_m_y_d/fm_y_d) + km * (sigma_m_z_d/fm_z_d)
    util_bending_comp_z_1 = (abs(sigma_c_0_d)/(kc_z * fc_0_d)) + km * (sigma_m_y_d/fm_y_d) + (sigma_m_z_d/fm_z_d)
    util_bending_comp_z_2 = (abs(sigma_c_0_d)/(fc_0_d))**2 + km * (sigma_m_y_d/fm_y_d) + (sigma_m_z_d/fm_z_d)
        
        
    util_bending_comp_y = max(util_bending_comp_y_1,util_bending_comp_y_2)
    util_bending_comp_z = max(util_bending_comp_z_1,util_bending_comp_z_2)

    return util_bending_comp_y, util_bending_comp_z


def utilisation_LTB(b, h, sigma_c_0_d, fc_0_d, sigma_t_0_d, sigma_m_y_d, fm_y_d, sigma_m_z_d, fm_z_d, k_crit_y, k_crit_z, kc_z, kc_y, km):

    util_LTB_capacity_y = (sigma_m_y_d-sigma_t_0_d)/(k_crit_y*fm_y_d) + km * sigma_m_z_d/fm_z_d
    util_LTB_capacity_z = (sigma_m_z_d-sigma_t_0_d)/(k_crit_z*fm_z_d) + km * sigma_m_y_d/fm_y_d

    util_LTB_capacity_y = (sigma_m_y_d/ (k_crit_y * fm_y_d))**2 + (abs(sigma_c_0_d)/(kc_z*fc_0_d))
    util_LTB_capacity_z = (sigma_m_z_d/ (k_crit_z * fm_z_d))**2 + (abs(sigma_c_0_d)/(kc_y*fc_0_d))

    if h >= b:
        util_LTB_capacity = util_LTB_capacity_y
    else:
        util_LTB_capacity = util_LTB_capacity_z

    return util_LTB_capacity


folder_path = os.path.join(ghcompfolder,'Alpaca4d/Material')

print(folder_path)


timber_properties, k_mod, safety_factor, straightness_factor = load_timber_properties(folder_path)

Area, W_y, W_z, I_y, I_z, I_t, radii_of_gyration_y, radii_of_gyration_z = section_properties(b, h)

material_type, fm_k, fv_k, fc_0_k, ft_0_k, E_mean, E0_05, G_mean, G0_05 = material_properties(timber_properties, Timber_Class)

km, gamma_m , kmod, ky_h, kz_h, kh = design_parameters(b, h, safety_factor, material_type, k_mod, service_class, duration)

kc_y, kc_z, kc, k_crit_y, k_crit_z = buckling_parameters(b, h, L_ey, L_ez, radii_of_gyration_y, radii_of_gyration_z, fm_k, fc_0_k, E0_05, straightness_factor, material_type)

sigma_c_0_d, sigma_t_0_d = axial_stress(N_x, Area)

sigma_m_y_d, sigma_m_z_d = bending_stress(M_y, M_z, W_y, W_z)

tau_d = shear_stress(V_y, V_z, b, h)

fc_0_d, ft_0_d = axial_resistance(kmod, fc_0_k, ft_0_k, gamma_m)

fm_y_d, fm_z_d = bending_resistance(kmod, ky_h, kz_h, fm_k, gamma_m)

fv_d = shear_resistance(kmod, fv_k, gamma_m)

util_axial_tens, util_axial_comp, util_axial = utilisation_axial(sigma_c_0_d, sigma_t_0_d, ft_0_d, fc_0_d, kc)

util_bending_y, util_bending_z = utilisation_bending(sigma_m_y_d, sigma_m_z_d, fm_y_d, fm_z_d, km)

util_shear = utilisation_shear(tau_d, fv_d)

util_bending_tens_y, util_bending_tens_z = utilisation_tension_bending(sigma_t_0_d, ft_0_d, sigma_m_y_d, fm_y_d, sigma_m_z_d, fm_z_d, km)

util_bending_comp_y, util_bending_comp_z = utilisation_compression_bending(sigma_c_0_d, fc_0_d, sigma_m_y_d, fm_y_d, sigma_m_z_d, fm_z_d, kc_y, kc_z, km)

util_LTB_capacity = utilisation_LTB(b, h, sigma_c_0_d, fc_0_d, sigma_t_0_d, sigma_m_y_d, fm_y_d, sigma_m_z_d, fm_z_d, k_crit_y, k_crit_z, kc_z, kc_y, km)



utilisation = [util_axial, util_bending_y, util_bending_z, util_shear, util_bending_tens_y, util_bending_tens_z, util_bending_comp_y, util_bending_comp_z, util_LTB_capacity]
utilisation = [round(number,2) for number in utilisation]



print("\n")
print("Util Axial: {}".format(abs(round(util_axial,2))))
print("Util Bending y: {}".format(abs(round(util_bending_y,2))))
print("Util Bending z: {}".format(abs(round(util_bending_z,2))))
print("Util Shear: {}".format(abs(round(util_shear,2))))

print("\n")
print("Util Combined Bending_y Tension: {}".format(abs(round(util_bending_tens_y,2))))
print("Util Combined Bending_z Tension: {}".format(abs(round(util_bending_tens_z,2))))
print("Util Combined Bending_y Compression: {}".format(abs(round(util_bending_comp_y,2))))
print("Util Combined Bending_z Compression: {}".format(abs(round(util_bending_comp_z,2))))
print("Util Lateral Buckling: {}".format(abs(round(util_LTB_capacity,2))))
# ---------- end tc ----------
tc_2 = TimberCheckAlpaca4d(
    BeamElement=fbc.Element,
    L_ey="2850",
    L_ez="3810",
    Timber_Class=timber_class_2,
    service_class=service_class_2,
    duration=duration_2,
    N_x=kn_to_n_7,
    V_y=kn_to_n_8,
    V_z=kn_to_n_9,
    M_x=knm_to_nmm_8,
    M_y=knm_to_nmm_7,
    M_z=knm_to_nmm_9)  # -> out, util_axial, util_bending_y, util_bending_z, util_shear, util_bending_tens_y, util_bending_tens_z, util_bending_comp_y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
# ---------- tc_2: Python ----------
import math
import json
import os

import sys
import Rhino.Geometry as rg
import Grasshopper as gh


ghenv.Component.Name = "Timber Check (Alpaca4d)"
ghenv.Component.NickName = 'TC'
ghenv.Component.Message = "Timber Check (Alpaca4d)"



## add alpaca install directory to system path

ghcompfolder = gh.Folders.DefaultAssemblyFolder
if ghcompfolder not in sys.path:
    sys.path.append(ghcompfolder)

try:
    from Alpaca4d import alpaca4d as alpaca
except:
    msg = "Cannot import Alpaca4d. Is the Alpaca4d folder available in " + ghcompfolder + "?"
    ghenv.Component.AddRuntimeMessage(gh.Kernel.GH_RuntimeMessageLevel.Error, msg)



# Opening JSON
def load_timber_properties(folder_path):

    collected_properties = []

    properties = ['timber_properties.json','k_mod.json','safety_factor.json','straightness_factor.json']

    for properti in properties:

        file_path = os.path.join(folder_path, properti)
        with open(file_path, 'r') as json_file:
            collected_properties.append(json.load(json_file))
    
    timber_properties, k_mod, safety_factor, straightness_factor = collected_properties

    return timber_properties, k_mod, safety_factor, straightness_factor


# Section Properties
def section_properties(b, h):

        Area = b * h

        W_y = (b * h**2) / 6
        W_z = (b**2 * h) / 6

        I_y = (b * h**3) / 12
        I_z = (b**3 * h) / 12

        I_t = 1/3 * b**3 * h * (1-0.63*(b/h))

        radii_of_gyration_y = (I_y/Area)**0.5
        radii_of_gyration_z = (I_z/Area)**0.5

        return Area, W_y, W_z, I_y, I_z, I_t, radii_of_gyration_y, radii_of_gyration_z


# Material Properties
def material_properties(timber_properties, Timber_Class):

        material_type = timber_properties[Timber_Class]["type"]
        fm_k = timber_properties[Timber_Class]["fm_k"]
        fv_k = timber_properties[Timber_Class]["fv_k"]
        fc_0_k = timber_properties[Timber_Class]["fc_0_k"]
        ft_0_k = timber_properties[Timber_Class]['ft_0_k']
        E_mean = timber_properties[Timber_Class]["E_mean"]
        E0_05 = timber_properties[Timber_Class]["E0_05"]
        G_mean = timber_properties[Timber_Class]["G_mean"]
        G0_05 = E0_05/16

        return material_type, fm_k, fv_k, fc_0_k, ft_0_k, E_mean, E0_05, G_mean, G0_05



# Design Factor
def design_parameters(b, h, safety_factor, material_type, k_mod, service_class, duration):

    km = 0.70
    gamma_m = safety_factor[material_type]
    kmod = k_mod[material_type][service_class][duration]

    print("kmod: {0:.2f}".format(kmod))


    ky_h = min( (150/h)**0.2 , 1.3 )
    kz_h = min( (150/b)**0.2 , 1.3 )

    ky_h = 1.0 if ky_h < 1.0 else ky_h
    kz_h = 1.0 if kz_h < 1.0 else kz_h

    print("ky_h: {0:.2f}".format(ky_h))
    print("kz_h: {0:.2f}".format(kz_h))


    kh = min(ky_h,kz_h)

    print("kh: {0:.2f}".format(kh))

    return km, gamma_m , kmod, ky_h, kz_h, kh


def buckling_parameters(b, h, L_ey, L_ez, radii_of_gyration_y, radii_of_gyration_z, fm_k, fc_0_k, E0_05, straightness_factor, material_type):
    

    lambda_y = L_ey / radii_of_gyration_y
    lambda_z = L_ez / radii_of_gyration_z

    print("lambda_y: {0:.2f}".format(lambda_y))
    print("lambda_z: {0:.2f}".format(lambda_z))


    lambda_rel_y = (lambda_y/math.pi) * (fc_0_k/E0_05)**0.5
    lambda_rel_z = (lambda_z/math.pi) * (fc_0_k/E0_05)**0.5

    print("lambda_rel_y: {0:.2f}".format(lambda_rel_y))
    print("lambda_rel_z: {0:.2f}".format(lambda_rel_z))


    beta_c = straightness_factor[material_type]

    k_y = 0.5 * (1 + beta_c * (lambda_rel_y - 0.3) + lambda_rel_y**2)
    k_z = 0.5 * (1 + beta_c * (lambda_rel_z - 0.3) + lambda_rel_z**2)

    print("k_y: {0:.2f}".format(k_y))
    print("k_z: {0:.2f}".format(k_z))


    kc_y = 1 / (k_y + math.sqrt(k_y**2 - lambda_rel_y**2))
    kc_z = 1 / (k_z + math.sqrt(k_z**2 - lambda_rel_z**2))

    print("kc_y: {0:.2f}".format(kc_y))
    print("kc_z: {0:.2f}".format(kc_z))


    kc = min(kc_y,kc_z)

    print("kc: {0:.2f}".format(kc))


    sigma_m_crit_y = E0_05 * (0.78 * b**2) / (h * L_ey)
    lambda_rel_m_y = math.sqrt(fm_k/sigma_m_crit_y)

    sigma_m_crit_z = E0_05 * (0.78 * h**2) / (b * L_ez)
    lambda_rel_m_z = math.sqrt(fm_k/sigma_m_crit_z)


    print("sigma_m_crit_y: {0:.2f}".format(sigma_m_crit_y))
    print("lambda_rel_m_y: {0:.2f}".format(lambda_rel_m_y))
    print("sigma_m_crit_z: {0:.2f}".format(sigma_m_crit_z))
    print("lambda_rel_m_z: {0:.2f}".format(lambda_rel_m_z))


    if lambda_rel_m_y < 0.75:
            k_crit_y = 1.00
    elif lambda_rel_m_y <= 1.40:
            k_crit_y = 1.56-0.75*lambda_rel_m_y
    elif lambda_rel_m_y > 1.40:
            k_crit_y = 1/lambda_rel_m_y**2


    if lambda_rel_m_z < 0.75:
            k_crit_z = 1.00
    elif lambda_rel_m_z <= 1.40:
            k_crit_z = 1.56-0.75*lambda_rel_m_z
    elif lambda_rel_m_z > 1.40:
            k_crit_z = 1/lambda_rel_m_z**2

    print("k_crit_y: {0:.2f}".format(k_crit_y))
    print("k_crit_z: {0:.2f}".format(k_crit_z))
    print("\n")

    return kc_y, kc_z, kc, k_crit_y, k_crit_z



# Design Strength

def axial_stress(N_x, Area):
    if N_x < 0.00:
            sigma_c_0_d = abs(N_x) / Area
            sigma_t_0_d = 0.00
            print("sigma_c_0_d: {0:.2f}".format(sigma_c_0_d))
            print("sigma_t_0_d: {0:.2f}".format(sigma_t_0_d))
    elif N_x > 0.00:
            sigma_c_0_d = 0.00
            sigma_t_0_d = abs(N_x) / Area
            print("sigma_c_0_d: {0:.2f}".format(sigma_c_0_d))
            print("sigma_t_0_d: {0:.2f}".format(sigma_t_0_d))
    else:
            sigma_c_0_d = 0.00
            sigma_t_0_d = 0.00
            print("sigma_c_0_d: {0:.2f}".format(sigma_c_0_d))
            print("sigma_t_0_d: {0:.2f}".format(sigma_t_0_d))
    
    return sigma_c_0_d, sigma_t_0_d


def bending_stress(M_y, M_z, W_y, W_z):
    
    sigma_m_y_d = abs(M_y) / W_y
    sigma_m_z_d = abs(M_z) / W_z
    
    print("sigma_m_y_d: {0:.2f}".format(sigma_m_y_d))
    print("sigma_m_z_d: {0:.2f}".format(sigma_m_z_d))

    return sigma_m_y_d, sigma_m_z_d


def shear_stress(V_y, V_z, b, h):

    k_cr = 0.67
    Area_eff = b * k_cr * h
    tau_y_d = 1.5 * abs(V_y) / Area_eff
    tau_z_d = 1.5 * abs(V_z) / Area_eff

    tau_d = math.sqrt(tau_y_d**2 + tau_z_d**2)

    print("tau_y_d: {0:.2f}".format(tau_y_d))
    print("tau_z_d: {0:.2f}".format(tau_z_d))
    print("tau_d: {0:.2f}".format(tau_d))

    return tau_d


def axial_resistance(kmod, fc_0_k, ft_0_k, gamma_m):

    fc_0_d = kmod * fc_0_k / gamma_m
    ft_0_d = kh * kmod * ft_0_k / gamma_m

    print("fc_0_d: {0:.2f}".format(fc_0_d))
    print("ft_0_d: {0:.2f}".format(ft_0_d))

    return fc_0_d, ft_0_d


def bending_resistance(kmod, ky_h, kz_h, fm_k, gamma_m):

    fm_y_d = kmod * ky_h * fm_k / gamma_m
    fm_z_d = kmod * kz_h * fm_k / gamma_m

    print("fm_y_d: {0:.2f}".format(fm_y_d))
    print("fm_z_d: {0:.2f}".format(fm_z_d))
    return fm_y_d, fm_z_d


def shear_resistance(kmod, fv_k, gamma_m):

    fv_d = kmod * fv_k / gamma_m
    print("fv_d: {0:.2f}".format(fv_d))

    return fv_d



# Design Combination

def utilisation_axial(sigma_c_0_d, sigma_t_0_d, ft_0_d, fc_0_d, kc):
    
    util_axial_tens = sigma_t_0_d/ft_0_d
    util_axial_comp = abs(sigma_c_0_d/(kc*fc_0_d))
    util_axial = max(util_axial_tens,util_axial_comp)

    return util_axial_tens, util_axial_comp, util_axial


def utilisation_bending(sigma_m_y_d, sigma_m_z_d, fm_y_d, fm_z_d, km):

    util_bending_y_1 = sigma_m_y_d/fm_y_d
    util_bending_y_2 = km * sigma_m_y_d/fm_y_d

    util_bending_z_1 = sigma_m_z_d/fm_z_d
    util_bending_z_2 = km * sigma_m_z_d/fm_z_d

    util_bending_y = max(util_bending_y_1,util_bending_y_2)
    util_bending_z = max(util_bending_z_1,util_bending_z_2)

    return util_bending_y, util_bending_z

def utilisation_shear(tau_d, fv_d):

    util_shear = tau_d/fv_d

    return util_shear


def utilisation_tension_bending(sigma_t_0_d, ft_0_d, sigma_m_y_d, fm_y_d, sigma_m_z_d, fm_z_d, km):
    
    util_bending_tens_y = (sigma_t_0_d/ft_0_d) + (sigma_m_y_d/fm_y_d) + km * (sigma_m_z_d/fm_z_d)
    util_bending_tens_z = (sigma_t_0_d/ft_0_d) + km * (sigma_m_y_d/fm_y_d) + (sigma_m_z_d/fm_z_d)

    return util_bending_tens_y, util_bending_tens_z


def utilisation_compression_bending(sigma_c_0_d, fc_0_d, sigma_m_y_d, fm_y_d, sigma_m_z_d, fm_z_d, kc_y, kc_z, km):

    util_bending_comp_y_1 = (abs(sigma_c_0_d)/(kc_y * fc_0_d)) + (sigma_m_y_d/fm_y_d) + km * (sigma_m_z_d/fm_z_d)
    util_bending_comp_y_2 = (abs(sigma_c_0_d)/(fc_0_d))**2 + (sigma_m_y_d/fm_y_d) + km * (sigma_m_z_d/fm_z_d)
    util_bending_comp_z_1 = (abs(sigma_c_0_d)/(kc_z * fc_0_d)) + km * (sigma_m_y_d/fm_y_d) + (sigma_m_z_d/fm_z_d)
    util_bending_comp_z_2 = (abs(sigma_c_0_d)/(fc_0_d))**2 + km * (sigma_m_y_d/fm_y_d) + (sigma_m_z_d/fm_z_d)
        
        
    util_bending_comp_y = max(util_bending_comp_y_1,util_bending_comp_y_2)
    util_bending_comp_z = max(util_bending_comp_z_1,util_bending_comp_z_2)

    return util_bending_comp_y, util_bending_comp_z


def utilisation_LTB(b, h, sigma_c_0_d, fc_0_d, sigma_t_0_d, sigma_m_y_d, fm_y_d, sigma_m_z_d, fm_z_d, k_crit_y, k_crit_z, kc_z, kc_y, km):

    util_LTB_capacity_y = (sigma_m_y_d-sigma_t_0_d)/(k_crit_y*fm_y_d) + km * sigma_m_z_d/fm_z_d
    util_LTB_capacity_z = (sigma_m_z_d-sigma_t_0_d)/(k_crit_z*fm_z_d) + km * sigma_m_y_d/fm_y_d

    util_LTB_capacity_y = (sigma_m_y_d/ (k_crit_y * fm_y_d))**2 + (abs(sigma_c_0_d)/(kc_z*fc_0_d))
    util_LTB_capacity_z = (sigma_m_z_d/ (k_crit_z * fm_z_d))**2 + (abs(sigma_c_0_d)/(kc_y*fc_0_d))

    if h >= b:
        util_LTB_capacity = util_LTB_capacity_y
    else:
        util_LTB_capacity = util_LTB_capacity_z

    return util_LTB_capacity


folder_path = os.path.join(ghcompfolder,'Alpaca4d/Material')


b = BeamElement.CrossSection.b
h = BeamElement.CrossSection.h

print(folder_path)


timber_properties, k_mod, safety_factor, straightness_factor = load_timber_properties(folder_path)

Area, W_y, W_z, I_y, I_z, I_t, radii_of_gyration_y, radii_of_gyration_z = section_properties(b, h)

material_type, fm_k, fv_k, fc_0_k, ft_0_k, E_mean, E0_05, G_mean, G0_05 = material_properties(timber_properties, Timber_Class)

km, gamma_m , kmod, ky_h, kz_h, kh = design_parameters(b, h, safety_factor, material_type, k_mod, service_class, duration)

kc_y, kc_z, kc, k_crit_y, k_crit_z = buckling_parameters(b, h, L_ey, L_ez, radii_of_gyration_y, radii_of_gyration_z, fm_k, fc_0_k, E0_05, straightness_factor, material_type)

sigma_c_0_d, sigma_t_0_d = axial_stress(N_x, Area)

sigma_m_y_d, sigma_m_z_d = bending_stress(M_y, M_z, W_y, W_z)

tau_d = shear_stress(V_y, V_z, b, h)

fc_0_d, ft_0_d = axial_resistance(kmod, fc_0_k, ft_0_k, gamma_m)

fm_y_d, fm_z_d = bending_resistance(kmod, ky_h, kz_h, fm_k, gamma_m)

fv_d = shear_resistance(kmod, fv_k, gamma_m)

util_axial_tens, util_axial_comp, util_axial = utilisation_axial(sigma_c_0_d, sigma_t_0_d, ft_0_d, fc_0_d, kc)

util_bending_y, util_bending_z = utilisation_bending(sigma_m_y_d, sigma_m_z_d, fm_y_d, fm_z_d, km)

util_shear = utilisation_shear(tau_d, fv_d)

util_bending_tens_y, util_bending_tens_z = utilisation_tension_bending(sigma_t_0_d, ft_0_d, sigma_m_y_d, fm_y_d, sigma_m_z_d, fm_z_d, km)

util_bending_comp_y, util_bending_comp_z = utilisation_compression_bending(sigma_c_0_d, fc_0_d, sigma_m_y_d, fm_y_d, sigma_m_z_d, fm_z_d, kc_y, kc_z, km)

util_LTB_capacity = utilisation_LTB(b, h, sigma_c_0_d, fc_0_d, sigma_t_0_d, sigma_m_y_d, fm_y_d, sigma_m_z_d, fm_z_d, k_crit_y, k_crit_z, kc_z, kc_y, km)



utilisation = [util_axial, util_bending_y, util_bending_z, util_shear, util_bending_tens_y, util_bending_tens_z, util_bending_comp_y, util_bending_comp_z, util_LTB_capacity]
utilisation = [round(number,2) for number in utilisation]



print("\n")
print("Util Axial: {}".format(abs(round(util_axial,2))))
print("Util Bending y: {}".format(abs(round(util_bending_y,2))))
print("Util Bending z: {}".format(abs(round(util_bending_z,2))))
print("Util Shear: {}".format(abs(round(util_shear,2))))

print("\n")
print("Util Combined Bending_y Tension: {}".format(abs(round(util_bending_tens_y,2))))
print("Util Combined Bending_z Tension: {}".format(abs(round(util_bending_tens_z,2))))
print("Util Combined Bending_y Compression: {}".format(abs(round(util_bending_comp_y,2))))
print("Util Combined Bending_z Compression: {}".format(abs(round(util_bending_comp_z,2))))
print("Util Lateral Buckling: {}".format(abs(round(util_LTB_capacity,2))))
# ---------- end tc_2 ----------
panel_3 = Panel(tc.utilisation)
panel_4 = Panel(tc_2.utilisation)
panel_5 = Panel(tc_2.out)
