# Grasshopper definition Alpaca4d_Steel_Section_Database_MP.gh (Grasshopper 1.0.7)

# Shift a branch
# The branch of the "index" moves at the end of the tree
# Get Items of a branch
panel = Panel("7850")
uem = UniaxialElasticMaterialAlpaca4d(E="2.1e9", v="0.3", rho=panel)  # -> out, uniAxialMaterial
# ---------- uem: Python ----------
"""
Create a uniaxial Elastic Material
-
    Args:
        E:
        Eneg:
        eta:
        G:
        v:
        rho:
    Returns:
        uniAxialMaterial:
"""

ghenv.Component.Name = "uniaxial Elastic Material (Alpaca4d)"
ghenv.Component.NickName = 'UEM'
ghenv.Component.Message = "uniaxial Elastic (Alpaca4d)"

import sys
import Rhino.Geometry as rg
import Grasshopper as gh
import copy


## add alpaca install directory to system path

ghcompfolder = gh.Folders.DefaultAssemblyFolder
if ghcompfolder not in sys.path:
    sys.path.append(ghcompfolder)

try:
    from Alpaca4d import alpaca4d as alpaca
except:
    msg = "Cannot import Alpaca4d. Is the Alpaca4d folder available in " + ghcompfolder + "?"
    ghenv.Component.AddRuntimeMessage(gh.Kernel.GH_RuntimeMessageLevel.Error, msg)


checkData = True

if not E:
    checkData = False
    msg = "Input parameter E failed to collect data"
    ghenv.Component.AddRuntimeMessage(gh.Kernel.GH_RuntimeMessageLevel.Warning, msg)

if not G and not v:
    checkData = False
    msg = "Input parameter G or v failed to collect data"
    ghenv.Component.AddRuntimeMessage(gh.Kernel.GH_RuntimeMessageLevel.Warning, msg)

if not rho:
    checkData = False
    msg = "Input parameter rho failed to collect data"
    ghenv.Component.AddRuntimeMessage(gh.Kernel.GH_RuntimeMessageLevel.Warning, msg)



if checkData:
    uniAxialMaterial = alpaca.uniAxialMaterialElastic(name, E, Eneg, eta, G, v, rho, attributes)
# ---------- end uem ----------
number_slider = Slider(0, range=0..20)
shape = ValueList({"I", "O", "[]"}, selected="I")
csl = CrossSectionLibraryAlpaca4d(name="HEA500", material=uem.uniAxialMaterial)  # -> out, section_family, Section; inputs index: Int32
# ---------- csl: Python ----------
"""
Create timber material attributes
-
    Args:
        shape: I, O, []
        name:
        index:
        material:
    Returns:
        section_family:
        Section:

"""

__author__ = "Marco Intelisano"
__contact__ = "intelisano.marco@gmail.com" 
__linkedIn__ = "https://www.linkedin.com/in/engineermarcointelisano/"



ghenv.Component.Name = "Cross Section Library (Alpaca4d)"
ghenv.Component.NickName = 'CSL'
ghenv.Component.Message = "Cross Section Library (Alpaca4d)"


import os
import sys
import Rhino.Geometry as rg
import Grasshopper as gh
import copy
import json

## add alpaca install directory to system path

ghcompfolder = gh.Folders.DefaultAssemblyFolder
if ghcompfolder not in sys.path:
    sys.path.append(ghcompfolder)

try:
    from Alpaca4d import alpaca4d as alpaca
except:
    msg = "Cannot import Alpaca4d. Is the Alpaca4d folder available in " + ghcompfolder + "?"
    ghenv.Component.AddRuntimeMessage(gh.Kernel.GH_RuntimeMessageLevel.Error, msg)


# Opening JSON 
steel_sectionlibrary = os.path.join(ghcompfolder,'Alpaca4d/Section/steel_section.json')

with open(steel_sectionlibrary, 'r') as json_file:
    steel_section_properties = json.load(json_file)



checkData = True

if not material:
    checkData = False
    msg = "Input parameter material failed to collect data"
    ghenv.Component.AddRuntimeMessage(gh.Kernel.GH_RuntimeMessageLevel.Warning, msg)




shape = "I" if shape is None else shape
index = 0 if index is None else index




section_family = steel_section_properties.get(shape)

if section_family == None:
    checkData = False
    msg = "Could not find cross sections that match '{}'".format(shape)
    ghenv.Component.AddRuntimeMessage(gh.Kernel.GH_RuntimeMessageLevel.Error, msg)

else:
    if not name:
        if index or int(index) == 0:
            name = list(section_family)[index]
    
    section = section_family.get(name)
    
    
    if section == None:
        checkData = False
        msg = "Could not find cross sections that match '{}'".format(name)
        ghenv.Component.AddRuntimeMessage(gh.Kernel.GH_RuntimeMessageLevel.Error, msg)


if checkData:
    
    if section:
        
        if shape == "I":
            
            secName = name
            Bsup = section["b"]
            tsup = section["tf"]
            Binf = section["b"]
            tinf = section["tf"]
            H = section["h"]
            tw = section["tw"]
            
            
            Section = alpaca.I_Section(secName, Bsup, tsup, Binf, tinf, H, tw, material)
        
        elif shape == "O":
            
            secName = name
            d = section["d"]
            t = section["t"]
            
            Section = alpaca.CircleCS(secName, d, t, material)
    
        elif shape == "[]":
            
            secName = name
            width = section["b"]
            height = section["h"]
            t_sides = section["t"]
            t_bottom = section["t"]
            t_upper = section["t"]
            
            Section = alpaca.Rectangular_HollowSection(secName, width, height, t_sides, t_bottom, t_upper, material)

print("section: {}".format(name))
# ---------- end csl ----------
python = GhPythonScript()  # -> out, a
# ---------- python: Python ----------
import Grasshopper as gh

msg = "text"
ghenv.Component.AddRuntimeMessage(gh.Kernel.GH_RuntimeMessageLevel.Remark, msg)
# ---------- end python ----------
panel_2 = Panel(csl.out)
# H Start Arc
# H Max Arc
# Arches
# Beams over Arches
# Panel 3
# H Panel 4
# Beams over Panel 4
# H Panel 5
# Beams
# Panel 1-5
# Beams over Panel 5
# Foundaments
# Foundaments
# Foundaments
# 1. Floor
# 1. Floor Mesh
# Floors
# 1. Floor
# Beams
# Panel 6-11
# Floors points
# 2. Floor
# Floors breps
# Connection
# 3. Floor
# Lantern + Dome
# Lantern
# Dome
# Lantern + Dome
panel_3 = Panel(csl.Section)
panel_4 = Panel(csl.section_family)
