# Grasshopper definition boltCapacity_TO FINALISE.gh (Grasshopper 1.0.7)

# Format Engineers CAD Information Issue Disclaimer
# 
# Project: PROJECT NAME
# 
# You should use this model for reference purposes only to assist in co-ordinating your work and is supplementary to formally issued drawings. Once the data is introduced into your own CAD or other system Format Engineers Ltd. can take no responsibility for its accuracy.
# 
# The last set of formally issued paper drawings are the contractual documents which represent the current stage of design development. If you have any queries, please contact the project CAD co-ordinator or the CAD Development Team.
# 
# Changes:
# 
# YYYY-MM-DD: Summary of changes
# 
# Usage notes:
# 
# This definition includes a basic implementation of Merbarki's Farthest Point Seeding algorithm (2005), adapted for tracing lines of principal curvature on NURBS surfaces. Requires modified Triangle.NET, if this isn't attached then... good luck! There are currently two main limitations: (a) this implementation measures density in parameter space, and (b) it doesn't include the dynamic refinement of density that Mebarki suggests.
number_slider = Slider(23, range=10..30)
panel = Panel("85")
_444pin_connection = PinConnection(fy="450", fup="650", d0=number_slider, t_middlePlate="25", t_lateralPlates="20", FvEd="120")  # -> out, FvRd, FbRd, Mrd
# ---------- _444pin_connection: Python ----------
import Rhino.Geometry as rg
import Grasshopper as gh
import math

ghenv.Component.Name = 'Pin Connection'

def checkPin(fy, fup, d0, t_middlePlate, t_lateralPlates, FvEd):

    gamma_zero = 1.1
    gamma_two = 1.25
    
    error = []
    
    pinGeometry = rg.Brep.CreatePlanarBreps(rg.Circle(d0/2).ToNurbsCurve())
    CircleProperties = rg.AreaMassProperties.Compute(pinGeometry)
    area = CircleProperties.Area
    momentOfInertia = CircleProperties.CentroidCoordinatesMomentsOfInertia
    Weff = (momentOfInertia / d0 * 0.5).X
    
    FvRd = (0.6 * area * fup/gamma_two) / 1000          #kN
    FbRd = (1.5 * t_middlePlate * d0 * fy / gamma_zero) / 1000      #kN
    Mrd = (1.5 * Weff *fy / gamma_zero) / 1000          #kNm
    
    ## Figure 3.11 EN 1993-1-8:2005
    Med = (FvEd/8.0) * ( (t_middlePlate/1000) + 2 * (t_lateralPlates/1000) )      #kNm 
    
    
    utilisationShear = FvEd / FvRd
    utilisationBending = Med / Mrd
    utilisationCombinedAction = (Med/Mrd)**2 + (FvEd/FvRd)**2
    
    ## Geometric Constrain
    ## Table 3.9 EN 1993-1-8:2005
    min_thickness = 0.7 * math.sqrt( (FvEd * 1000 * gamma_zero) / fy)
    max_d0 = 2.5 * t_middlePlate        # diameter has to be bigger greater than this value
    
    if utilisationShear >= 1.00:
        msg = 'Pin is failing due to shear'
        ghenv.Component.AddRuntimeMessage(gh.Kernel.GH_RuntimeMessageLevel.Warning, msg)
        error.append(msg)
    
    if utilisationBending >= 1.00:
        msg = 'Pin is failing due to Combined shear and bending'
        ghenv.Component.AddRuntimeMessage(gh.Kernel.GH_RuntimeMessageLevel.Warning, msg)
        error.append(msg)
    
    if utilisationCombinedAction >= 1.00:
        msg = 'Pin is failing due to Combined shear and bending'
        ghenv.Component.AddRuntimeMessage(gh.Kernel.GH_RuntimeMessageLevel.Warning, msg)
        error.append(msg)
    
    
    
    print('FvRd: {0} kN'.format(round(FvRd,2)))
    print('FbRd: {0} kN'.format(round(FbRd,2)))
    print('Med: {0} kNm'.format(round(Med,5)))
    print('Mrd: {0} kNm'.format(round(Mrd,2)))
    
    print('utilisationShear: {0}'.format(round(utilisationShear,2)))
    print('utilisationBending: {0}'.format(round(utilisationBending,2)))
    print('utilisationCombinedAction: {0}'.format(round(utilisationCombinedAction,2)))
    
    print('thickness greater than {0} mm'.format(int(min_thickness)))
    print('d0 smaller than {0} mm'.format(int(max_d0)))
    
    
    if error:
        ghenv.Component.Message = 'Pin Failure'
    else:
        ghenv.Component.Message = ''
    
    return FvRd, FbRd, Mrd

checkData = True


if not(fy and fup and d0 and t_middlePlate and t_lateralPlates and FvEd):
    checkData = False
    ghenv.Component.AddMessageForWarnings('insert all the Inputs')

if checkData:
    FvRd, FbRd, Mrd = checkPin(fy, fup, d0,t_middlePlate, t_lateralPlates, FvEd)
# ---------- end _444pin_connection ----------
panel_2 = Panel(_444pin_connection.FvRd)
panel_3 = Panel("500")
bc = BoltCapacityAlpaca4d(d0="12", t_plate="25", FvEd="120", FtEd="20", design=Toggle(True))  # -> out, FvRd, BpRd, FtRd, FbRd, utilisationCombinedAction, Design; inputs countersunk: Boolean, edgeBolt: Boolean, endBolt: Boolean, design: Boolean
# ---------- bc: Python ----------
"""Provides a scripting component.
    Inputs:
        boltClass: '4.6', '4.8', '5.6', '5.8', '6.8', '8.8', ' 10.9'
        d0: Bolt diameter [mm]
        countersunk:
        edgeBolt: perpendicular to the direction of Load transfer
        endBolt: in the direction of the Load
        steelClass: 'S235', 'S275', 'S355', 'S460'
        t_plate: thickness of plate [mm]
        e1: end distance [mm]
        e2: edge distance [mm]
        p1: spacing along in the direction of the Load [mm]
        p2: spacing perpendicular to the direction of Load Transfer [mm]
        FvEd: Design Shear Force [kN]
        FtEd: Design Tension Force [kN]
    Output:
        FvRd: Bolt's Shear Resistance
        BpRd: Plate's Bearing Capacity of Plate
        FtRd: Bolt's Tension Capacity
        FbRd: Plate Punching Capacity
        utilisationCombinedAction:"""






__author__ = "Marco Pellegrino"
__contact__ = "pellegrino.marco@icloud.com"
__linkedIn__ = "https://www.linkedin.com/in/mp0110/"





import Rhino.Geometry as rg
import math
import Grasshopper as gh

checkData = True

boltClass = "10.9" if boltClass is None else boltClass
steelClass = "S355" if steelClass is None else steelClass


countersunk = False if countersunk is None else countersunk
edgeBolt = False if edgeBolt is None else edgeBolt
endBolt = False if endBolt is None else endBolt
design = False if design is None else design




if not d0:
    checkData = False
    msg = "Input parameter d0 failed to collect data"
    ghenv.Component.AddRuntimeMessage(gh.Kernel.GH_RuntimeMessageLevel.Warning, msg)

if not t_plate:
    checkData = False
    msg = "Input parameter t_plate failed to collect data"
    ghenv.Component.AddRuntimeMessage(gh.Kernel.GH_RuntimeMessageLevel.Warning, msg)


bolt_pool = [6,8,10,12,14,16,18,20,22,27,30,33,36,39]



def tensionResistance(k2, fub, As, gamma_two):
    FtRd = ((k2 * fub * As) / gamma_two) / 1000          #kN
    FtRd = round(FtRd,2)
    return FtRd

def bearingResistance(k1, alfa_b, fu, d0, t_plate, gamma_two):
    FbRd = ((k1 * alfa_b * fu * d0 * t_plate) / gamma_two) / 1000
    return FbRd

def punchingShearResistance(d0, t_plate, fu, gamma_two):
    BpRd = ((0.6 * math.pi * d0 * t_plate * fu) / gamma_two) / 1000     #kN
    BpRd = round(BpRd,2)
    return BpRd

def shearResistance(alfa_v, As, fub, gamma_two):
    FvRd = ((alfa_v * As * fub)/gamma_two) / 1000          #kN
    FvRd = round(FvRd,2)
    return FvRd

if checkData:

    # Define Geometry

    pinGeometry = rg.Brep.CreatePlanarBreps(rg.Circle(d0/2).ToNurbsCurve())
    CircleProperties = rg.AreaMassProperties.Compute(pinGeometry)
    area = CircleProperties.Area
    
    
    areaDict = {'M6' : {'As': 20.1 ,'Ag': area},
                'M8' : {'As': 36.6 ,'Ag': area},
                'M10': {'As': 58.0 ,'Ag': area},
                'M12': {'As': 84.3,'Ag': area},
                'M14': {'As': 115,'Ag': area},
                'M16': {'As': 157,'Ag': area},
                'M18': {'As': 192,'Ag': area},
                'M20': {'As': 245,'Ag': area},
                'M22': {'As': 303,'Ag': area},
                'M24': {'As': 353,'Ag': area},
                'M27': {'As': 459,'Ag': area},
                'M30': {'As': 561,'Ag': area},
                'M33': {'As': 694,'Ag': area},
                'M36': {'As': 817,'Ag': area},
                'M39': {'As': 976,'Ag': area}}
    
    sizeBolt = 'M{}'.format(int(d0))
    
    As = areaDict[sizeBolt]['As']
    Ag = areaDict[sizeBolt]['Ag']
    
    ## Define safety Factor
    gamma_zero = 1.0
    gamma_two = 1.25
    
    # Define bolt properties
    boltDict = {'4.6' : {"fy" : 240, "fu" : 400 },
                '4.8' : {"fy" : 320, "fu" : 400 },
                '5.6' : {"fy" : 300, "fu" : 500 },
                '5.8' : {"fy" : 400, "fu" : 500 },
                '6.8' : {"fy" : 480, "fu" : 600 },
                '8.8' : {"fy" : 640, "fu" : 800 },
                '10.9': {"fy" : 900, "fu" : 1000 }}
    
    #Define material properties
    steelDict = {'S235' : {"fy" : 235, "fu" : 360 },
                 'S275' : {"fy" : 275, "fu" : 430 },
                 'S355' : {"fy" : 355, "fu" : 510 },
                 'S460' : {"fy" : 460, "fu" : 560 }}
    
    # check Distance
    
    e1min = 1.2 * d0
    e2min = 1.2 * d0
    p1min = 2.2 * d0
    p2min = 2.4 * d0
    
    # assign minimum number if any
    e1 = e1min if e1 is None else e1
    e2 = e2min if e2 is None else e2
    p1 = p1min if p1 is None else p1
    p2 = p2min if p2 is None else p2
    
    
    if e1 < e1min:
        ghenv.Component.AddMessageForWarnings('e1 should be greater than 1.2*d0')
    
    if e2 < e2min:
        ghenv.Component.AddMessageForWarnings('e2 should be greater than 1.2*d0')
    
    if p1 < p1min:
        ghenv.Component.AddMessageForWarnings('p1 should be greater than 2.2*d0')
    
    if p2 < p2min:
        ghenv.Component.AddMessageForWarnings('p2 should be greater than 2.4*d0')
    
    
    
    
    ## Shear factor
    if boltClass == '4.6' or boltClass == '5.6' or boltClass == '8.8':
        alfa_v = 0.6
    elif boltClass == '4.8' or boltClass == '5.8' or boltClass == '6.8' or boltClass == '10.9':
        alfa_v = 0.5
    
    alfa_v = alfa_v
    
    
    ##bolt resistance
    fyb = boltDict[boltClass]["fy"]         #MPa
    fub = boltDict[boltClass]["fu"]         #MPa
    
    ##steel resistance
    fy = steelDict[steelClass]["fy"]        #MPa
    fu = steelDict[steelClass]["fu"]        #MPa
    
    
    ## Shear resistance per shear plane
    
    FvRd = shearResistance(alfa_v, As, fub, gamma_two)
    
    ##################################################
    
    ## perpendicular to the direction of load transfer
    k = []
    
    if edgeBolt:
        
        k.append( (2.8 * e2/d0) - 1.7 )
        k.append( (1.4 * p2/d0) - 1.7 )
        k.append( 2.5 )
    else:
        k.append( (1.4 * p2/d0) - 1.7 )
        k.append( 2.5 )
    
    k1 = min(k)
    
    ## in direction of load transfer
    
    if endBolt:
        alfa_d =  e1/ (3*d0)
    else:
        alfa_d = p1/ (3*d0) - 0.25 
    
    alfa_d = alfa_d
    
    
    alfa_b = min([alfa_d, fub/fu, 1.0])
    
    FbRd = bearingResistance(k1, alfa_b, fu, d0, t_plate, gamma_two)
    

    ## Tension Resistance
    
    if countersunk:
        k2 = 0.63
    else:
        k2 = 0.9
    
    FtRd = tensionResistance(k2, fub, As, gamma_two)
    
    
    ## Punching Shear Resistance
    BpRd = punchingShearResistance(d0, t_plate, fu, gamma_two)
    
    ## Combined Shear and Tension
    
    
    ShearResistance = min([FvRd,FbRd])
    TensionResistance = min([FtRd,BpRd])
    
    utilisationCombinedAction =  FvEd/ShearResistance + FtEd/(1.4 * TensionResistance)
    utilisationCombinedAction = round(utilisationCombinedAction,2)
    
    
    
    
    print('FvRd = {} kN'.format(FvRd))
    print('BpRd = {} kN'.format(BpRd))
    print('FtRd = {} kN'.format(FtRd))
    print('FbRd = {} kN'.format(FbRd))





def tensionResistance(k2, fub, As, gamma_two):
    FtRd = ((k2 * fub * As) / gamma_two) / 1000          #kN
    FtRd = round(FtRd,2)
    return FtRd

def bearingResistance(k1, alfa_b, fu, d0, t_plate, gamma_two):
    FbRd = ((k1 * alfa_b * fu * d0 * t_plate) / gamma_two) / 1000
    return FbRd

def punchingShearResistance(d0, t_plate, fu, gamma_two):
    BpRd = ((0.6 * math.pi * d0 * t_plate * fu) / gamma_two) / 1000     #kN
    BpRd = round(BpRd,2)
    return BpRd

def shearResistance(alfa_v, As, fub, gamma_two):
    FvRd = ((alfa_v * As * fub)/gamma_two) / 1000          #kN
    FvRd = round(FvRd,2)
    return FvRd



if design:
    
    i = 0
    while utilisationCombinedAction > 1.0:
        
        
        d0 = bolt_pool[i]
        sizeBolt = 'M{}'.format(int(d0))
        
        As = areaDict[sizeBolt]['As']
        
        FtRd = tensionResistance(k2, fub, As, gamma_two)
        BpRd = punchingShearResistance(d0, t_plate, fu, gamma_two)
        
        FbRd = bearingResistance(k1, alfa_b, fu, d0, t_plate, gamma_two)
        FvRd = shearResistance(alfa_v, As, fub, gamma_two)
        
        
        TensionResistance = min([FtRd,BpRd])
        ShearResistance = min([FvRd,FbRd])

        
        utilisationCombinedAction =  FvEd/ShearResistance + FtEd/(1.4 * TensionResistance)
        utilisationCombinedAction = round(utilisationCombinedAction,2)
        
        i += 1
    
    
    Design = sizeBolt
    print(utilisationCombinedAction)
# ---------- end bc ----------
panel_4 = Panel(bc.Design)
panel_5 = Panel(bc.utilisationCombinedAction)
