# Grasshopper definition multiLayered.gh (Grasshopper 1.0.7)

eim = ElasticIsotropicMaterialAlpaca4d(E="21000", v="0.3", rho="2500")  # -> out, nDMaterial
# ---------- eim: Python ----------
"""
Create a nD Elastic Isotropic Material
-
    Args:
        name:
        E:
        G:
        v:
        rho:
    Returns:
        nDMaterial:
"""

ghenv.Component.Name = "Elastic Isotropic Material (Alpaca4d)"
ghenv.Component.NickName = 'EIM'
ghenv.Component.Message = "Elastic Isotropic (Alpaca4d)"


import sys
import Rhino.Geometry as rg
import Grasshopper as gh
import copy


## add alpaca install directory to system path

ghcompfolder = gh.Folders.DefaultAssemblyFolder
if ghcompfolder not in sys.path:
    sys.path.append(ghcompfolder)

try:
    from Alpaca4d import alpaca4d as alpaca
except:
    msg = "Cannot import Alpaca4d. Is the Alpaca4d folder available in " + ghcompfolder + "?"
    ghenv.Component.AddRuntimeMessage(gh.Kernel.GH_RuntimeMessageLevel.Error, msg)


checkData = True

if not E:
    checkData = False
    msg = "Input parameter E failed to collect data"
    ghenv.Component.AddRuntimeMessage(gh.Kernel.GH_RuntimeMessageLevel.Warning, msg)

if not G and not v:
    checkData = False
    msg = "Input parameter G or v failed to collect data"
    ghenv.Component.AddRuntimeMessage(gh.Kernel.GH_RuntimeMessageLevel.Warning, msg)

if not rho:
    checkData = False
    msg = "Input parameter rho failed to collect data"
    ghenv.Component.AddRuntimeMessage(gh.Kernel.GH_RuntimeMessageLevel.Warning, msg)

if checkData:
    nDMaterial = alpaca.ElasticIsotropic(name, E, G, rho, v)
# ---------- end eim ----------
eim_2 = ElasticIsotropicMaterialAlpaca4d(E="21000", v="0.3", rho="2500")  # -> out, nDMaterial; same code as eim
eim_3 = ElasticIsotropicMaterialAlpaca4d(E="21000", v="0.3", rho="2500")  # -> out, nDMaterial; same code as eim
panel = Panel("""12
6
12""")
merge = Merge(Data1=eim.nDMaterial, Data2=eim_2.nDMaterial, Data3=eim_3.nDMaterial)
cs = CircularSectionAlpaca4d(thicknesses=panel, nDMaterial=merge)  # -> out, Section; inputs thicknesses: list, nDMaterial: list
# ---------- cs: Python ----------
"""
Create a Circle Cross Section
-
    Args:
        secName:
        Area:
        Izz:
        Iyy:
        J:
        alphaY:
        alphaZ:
        material:
    Returns:
        genericSection:
"""

ghenv.Component.Name = "Circular Section (Alpaca4d)"
ghenv.Component.NickName = 'CS'
ghenv.Component.Message = "Circular Section (Alpaca4d)"

import sys
import Rhino.Geometry as rg
import Grasshopper as gh
import copy


## add alpaca install directory to system path

ghcompfolder = gh.Folders.DefaultAssemblyFolder
if ghcompfolder not in sys.path:
    sys.path.append(ghcompfolder)

try:
    from Alpaca4d import alpaca4d as alpaca
except:
    msg = "Cannot import Alpaca4d. Is the Alpaca4d folder available in " + ghcompfolder + "?"
    ghenv.Component.AddRuntimeMessage(gh.Kernel.GH_RuntimeMessageLevel.Error, msg)


checkData = True

if not thicknesses:
    checkData = False
    msg = "Input parameter d failed to collect data"
    ghenv.Component.AddRuntimeMessage(gh.Kernel.GH_RuntimeMessageLevel.Warning, msg)


if not nDMaterial:
    checkData = False
    msg = "Input parameter nDMaterial failed to collect data"
    ghenv.Component.AddRuntimeMessage(gh.Kernel.GH_RuntimeMessageLevel.Warning, msg)


if len(thicknesses) != len(nDMaterial):
    checkData = False
    msg = "thickness and nDMaterial input required the same list length"
    ghenv.Component.AddRuntimeMessage(gh.Kernel.GH_RuntimeMessageLevel.Warning, msg)



class LayeredShell(object):
    
    
    subdivide_Layers = 3
    
    def __init__(self, sectionName, material, thickness):

        self.sectionName = sectionName
        self.material = material
        self.thickness = thickness

        self.numLayer = None
        self.sectionTag = None

    def ToString(self):
        return self.write_tcl()

    def write_tcl(self):
        # http://www.luxinzheng.net/download/OpenSEES/En_THUShell_OpenSEES.htm
        # section LayeredShell $sectionTag $nLayers $matTag1 $thickness1...$matTagn $thicknessn
        
        subDividedThickness = []
        for layerThickness in self.thickness:
            tempThick = []
            subLayerThickness = float(layerThickness / LayeredShell.subdivide_Layers)
            tempThick.append(subLayerThickness)
            tempThick = tempThick * LayeredShell.subdivide_Layers
            subDividedThickness.append(tempThick)
            #print(subLayerThickness)
            #print(tempThick)
        print(subDividedThickness)
        
        
        numLayer = 0
        for listElem in subDividedThickness:
            numLayer += len(listElem)
        
        
        self.numLayer = numLayer
            
        
        tcl_text = "section LayeredShell {} {} ".format(self.sectionTag, numLayer)
        for i in range(len(self.material)):
            for j in range(len(subDividedThickness[i])):
                
                tcl_text += str(self.material[i].matTag) + " "
                tcl_text += str(subDividedThickness[i][j]) + " "
        
        tcl_text += "\n"
        
        return tcl_text


Section = LayeredShell( secName, nDMaterial, thicknesses)

print(LayeredShell( secName, nDMaterial, thicknesses).write_tcl())
# ---------- end cs ----------
