# Grasshopper definition rayleigh.gh (Grasshopper 1.0.7)
# plug-ins: karambaGH

Z = UnitZ(Factor=1)
pt = ConstructPoint(XCoordinate=0, YCoordinate=0, ZCoordinate=0)
line = LineSDL(Start=pt, Direction=Z, Length=Slider(3, range=3..12))
matselect = MaterialSelectionKaramba3D(menu=[dropdown(1), dropdown(2)])
divide = DivideCurve(Curve=line, Count=10, Kinks=False)  # -> Points, Tangents, Parameters
uem = UniaxialElasticMaterialAlpaca4d(E="2.1e11", v="0.30", rho="7850")  # -> out, uniAxialMaterial
# ---------- uem: Python ----------
"""
Create a uniaxial Elastic Material
-
    Args:
        E:
        Eneg:
        eta:
        G:
        v:
        rho:
    Returns:
        uniAxialMaterial:
"""

ghenv.Component.Name = "uniaxial Elastic Material (Alpaca4d)"
ghenv.Component.NickName = 'UEM'
ghenv.Component.Message = "uniaxial Elastic (Alpaca4d)"

import sys
import Rhino.Geometry as rg
import Grasshopper as gh
import copy


## add alpaca install directory to system path

ghcompfolder = gh.Folders.DefaultAssemblyFolder
if ghcompfolder not in sys.path:
    sys.path.append(ghcompfolder)

try:
    from Alpaca4d import alpaca4d as alpaca
except:
    msg = "Cannot import Alpaca4d. Is the Alpaca4d folder available in " + ghcompfolder + "?"
    ghenv.Component.AddRuntimeMessage(gh.Kernel.GH_RuntimeMessageLevel.Error, msg)


checkData = True

if not E:
    checkData = False
    msg = "Input parameter E failed to collect data"
    ghenv.Component.AddRuntimeMessage(gh.Kernel.GH_RuntimeMessageLevel.Warning, msg)

if not G and not v:
    checkData = False
    msg = "Input parameter G or v failed to collect data"
    ghenv.Component.AddRuntimeMessage(gh.Kernel.GH_RuntimeMessageLevel.Warning, msg)

if not rho:
    checkData = False
    msg = "Input parameter rho failed to collect data"
    ghenv.Component.AddRuntimeMessage(gh.Kernel.GH_RuntimeMessageLevel.Warning, msg)



if checkData:
    uniAxialMaterial = alpaca.uniAxialMaterialElastic(name, E, Eneg, eta, G, v, rho)
# ---------- end uem ----------
pline = PolyLine(Vertices=divide.Points, Closed=False)
pt_2 = Point(pt)
toggle = BooleanToggle(True)
explode = Explode(Curve=pline, Recursive=True)  # -> flatten(Segments), Vertices
cross_section = CrossSectionKaramba3D(
    FamilyNameOfCrossSection="DefaultCroSec",
    Material=matselect,
    Height_cm="10",
    UpperFlangeWidth_cm="10",
    LowerFlangeWidth_cm="10",
    UpperFlangeThickness_cm="1",
    LowerFlangeThickness_cm="1",
    WebThickness_cm="1",
    FilletRadius_cm=0,
    mode="I")
division = Division(A="1", B=100)
division_2 = Division(A="10", B=100)
supp = SupportKaramba3D(PosInd=pt_2, menu=[buttons(on, on, on, on, on, on)])
is = ISectionAlpaca4d(Bsup=division_2, tsup=division, Binf=division_2, tinf=division, H=division_2, tw=division, material=uem.uniAxialMaterial)  # -> Section
# ---------- is: Python ----------
"""
Create a double T Cross Section
-
    Args:
        secName:
        Bsup:
        tsup:
        Binf:
        tinf:
        H:
        tw:
        material:
    Returns:
        Section:
"""
ghenv.Component.Name = "I Section (Alpaca4d)"
ghenv.Component.NickName = 'IS'
ghenv.Component.Message = "I Section (Alpaca4d)"

import sys
import Rhino.Geometry as rg
import Grasshopper as gh
import copy



## add alpaca install directory to system path

ghcompfolder = gh.Folders.DefaultAssemblyFolder
if ghcompfolder not in sys.path:
    sys.path.append(ghcompfolder)

try:
    from Alpaca4d import alpaca4d as alpaca
except:
    msg = "Cannot import Alpaca4d. Is the Alpaca4d folder available in " + ghcompfolder + "?"
    ghenv.Component.AddRuntimeMessage(gh.Kernel.GH_RuntimeMessageLevel.Error, msg)


checkData = True

if not Bsup:
    checkData = False
    msg = "Input parameter Bsup failed to collect data"
    ghenv.Component.AddRuntimeMessage(gh.Kernel.GH_RuntimeMessageLevel.Warning, msg)

if not tsup:
    checkData = False
    msg = "Input parameter tsup failed to collect data"
    ghenv.Component.AddRuntimeMessage(gh.Kernel.GH_RuntimeMessageLevel.Warning, msg)

if not Binf:
    checkData = False
    msg = "Input parameter Binf failed to collect data"
    ghenv.Component.AddRuntimeMessage(gh.Kernel.GH_RuntimeMessageLevel.Warning, msg)

if not tinf:
    checkData = False
    msg = "Input parameter tinf failed to collect data"
    ghenv.Component.AddRuntimeMessage(gh.Kernel.GH_RuntimeMessageLevel.Warning, msg)

if not H:
    checkData = False
    msg = "Input parameter H failed to collect data"
    ghenv.Component.AddRuntimeMessage(gh.Kernel.GH_RuntimeMessageLevel.Warning, msg)

if not tw:
    checkData = False
    msg = "Input parameter tw failed to collect data"
    ghenv.Component.AddRuntimeMessage(gh.Kernel.GH_RuntimeMessageLevel.Warning, msg)

if not material:
    checkData = False
    msg = "Input parameter material failed to collect data"
    ghenv.Component.AddRuntimeMessage(gh.Kernel.GH_RuntimeMessageLevel.Warning, msg)



if checkData:
    Section = alpaca.I_Section(secName, Bsup, tsup, Binf, tinf, H, tw, material)
# ---------- end is ----------
support = SupportAlpaca4d(Pos=pt_2, Tx=toggle, Ty=toggle, Tz=toggle, Rx=toggle, Ry=toggle, Rz=toggle)  # -> Support; inputs Pos: Point3d, Tx: Boolean, Ty: Boolean, Tz: Boolean, Rx: Boolean, Ry: Boolean, Rz: Boolean
# ---------- support: Python ----------
"""
Create a support
-
    Args:
        Pos:
        Tx:
        Ty:
        Tz:
        Rx:
        Ry:
    Returns:
        Support:
"""

ghenv.Component.Name = "Support (Alpaca4d)"
ghenv.Component.NickName = 'Support'
ghenv.Component.Message = "Support (Alpaca4d)"


import sys
import Rhino.Geometry as rg
import Grasshopper as gh


## add alpaca install directory to system path

ghcompfolder = gh.Folders.DefaultAssemblyFolder
if ghcompfolder not in sys.path:
    sys.path.append(ghcompfolder)

try:
    from Alpaca4d import alpaca4d as alpaca
except:
    msg = "Cannot import Alpaca4d. Is the Alpaca4d folder available in " + ghcompfolder + "?"
    ghenv.Component.AddRuntimeMessage(gh.Kernel.GH_RuntimeMessageLevel.Error, msg)

checkData = True


if not Pos:
    checkData = False
    msg = "Input parameter Pos failed to collect data"
    ghenv.Component.AddRuntimeMessage(gh.Kernel.GH_RuntimeMessageLevel.Warning, msg)

if checkData:
    Support = alpaca.Support(Pos, Tx, Ty, Tz, Rx, Ry, Rz)
# ---------- end support ----------
linetobeam = LineToBeamKaramba3D(Line=explode.Segments, CrossSection=cross_section, New=True, Remove=True, LimitDistance_m=0.005)  # -> Element, Points, Info
fbc = ForceBeamColumnAlpaca4d(Line=explode.Segments, Section=is)  # -> out, Element; inputs Line: Curve, Colour: Color, Z_Axis: Vector3d
# ---------- fbc: Python ----------
"""
Create a Force Beam Column
-
    Args:
        Line:
        Section:
        Colour:
        Z_Axis:
    Returns:
        Element:
"""

ghenv.Component.Name = "Force Beam Column (Alpaca4d)"
ghenv.Component.NickName = 'FBC'
ghenv.Component.Message = "Force Beam Column (Alpaca4d)"


import sys
import Rhino.Geometry as rg
import Grasshopper as gh
import ghpythonlib.components as ghcomp
from System.Drawing import Color

## add alpaca install directory to system path

ghcompfolder = gh.Folders.DefaultAssemblyFolder
if ghcompfolder not in sys.path:
    sys.path.append(ghcompfolder)

try:
    from Alpaca4d import alpaca4d as alpaca
except:
    msg = "Cannot import Alpaca4d. Is the Alpaca4d folder available in " + ghcompfolder + "?"
    ghenv.Component.AddRuntimeMessage(gh.Kernel.GH_RuntimeMessageLevel.Error, msg)


checkData = True

if not Line:
    checkData = False
    msg = "Input parameter Line failed to collect data"
    ghenv.Component.AddRuntimeMessage(gh.Kernel.GH_RuntimeMessageLevel.Warning, msg)


if not Section:
    checkData = False
    msg = "Input parameter Section failed to collect data"
    ghenv.Component.AddRuntimeMessage(gh.Kernel.GH_RuntimeMessageLevel.Warning, msg)

if not Colour:
    Colour = Color.Red


if not GeomTransf:
    GeomTransf = "Linear"

if checkData:
    
    if not Z_Axis:
        midPoint =  Line.PointAtNormalizedLength(0.5)
        parameter = Line.ClosestPoint(midPoint, 0.01)[1]
        Z_Axis = ghcomp.PerpFrame( Line, parameter )
    Element = alpaca.ForceBeamColumn(Line, Section, GeomTransf, Colour, Z_Axis)
# ---------- end fbc ----------
am = AssembleModelAlpaca4d(Element=fbc.Element, Support=support)  # -> out, AlpacaModel, Mass; inputs Element: list, Support: list, Load: list, Constraint: list
# ---------- am: Python ----------
"""
Create a FEA Model
-
    Args:
        Element:
        Support:
        Load:
        Constraint:
    Returns:
        AlpacaModel:
"""


import os
import sys
import ghpythonlib.treehelpers as th
import Rhino.Geometry as rg
import Rhino.Collections as rc
import rhinoscriptsyntax as rs
from collections import defaultdict, OrderedDict, deque
import copy
import time
import Grasshopper as gh



ghenv.Component.Name = "Assemble Model (Alpaca4d)"
ghenv.Component.NickName = 'AM'
ghenv.Component.Message = "Assemble Model_WIP (Alpaca4d)"


## add alpaca install directory to system path

ghcompfolder = gh.Folders.DefaultAssemblyFolder
if ghcompfolder not in sys.path:
    sys.path.append(ghcompfolder)

try:
    from Alpaca4d import alpaca4d as alpaca
    from Alpaca4d import alpaca4dUtil as alpacaUtil
except:
    msg = "Cannot import Alpaca4d. Is the Alpaca4d folder available in " + ghcompfolder + "?"
    ghenv.Component.AddRuntimeMessage(gh.Kernel.GH_RuntimeMessageLevel.Error, msg)


checkData = True

if not Element:
    checkData = False
    msg = "Input parameter Element failed to collect data"
    ghenv.Component.AddRuntimeMessage(gh.Kernel.GH_RuntimeMessageLevel.Warning, msg)

if not Support:
    checkData = False
    msg = "Input parameter Support failed to collect data"
    ghenv.Component.AddRuntimeMessage(gh.Kernel.GH_RuntimeMessageLevel.Warning, msg)


if checkData:
    
    FolderPath = rs.DocumentPath()
    os.chdir(FolderPath)
    
    # create the object model
    AlpacaModel = alpaca.Model()
    
    
    start = time.clock()
    #subdivide element per type
    
    for element in Element:
        if element.type == "Beam":
            AlpacaModel.beams.append(element)
        elif element.type == "Shell":
            AlpacaModel.shells.append(element)
        elif element.type == "Brick":
            AlpacaModel.bricks.append(element)
    
    
    end = time.clock() - start
    print("time to subdivide element {}".format(end))
    start = time.clock()
    
    # create a list of unique point
    # need to add the rigid constraint
    
    AlpacaModel.getuniquePoints(AlpacaModel.beams, AlpacaModel.shells, AlpacaModel.bricks, Constraint)
    
    
    end = time.clock() - start
    print("time to get uniquepoints {}".format(end))
    start = time.clock()
    
    
    #############
    # create node and assign to object
    #############
    
    if AlpacaModel.uniquePointsThreeNDF:
        AlpacaModel.py.append(alpaca.Model.write3ndf_tcl())
        for point in AlpacaModel.uniquePointsThreeNDF:
            node = alpaca.Node(point)
            node.ndf = 3
            node.setNodeTag(AlpacaModel)
            AlpacaModel.nodes.append( node )
        
            AlpacaModel.py.append(node.write_tcl())
    
    
    if AlpacaModel.uniquePointsSixNDF:
        AlpacaModel.py.append(alpaca.Model.write6ndf_tcl())
        for point in AlpacaModel.uniquePointsSixNDF:
            node = alpaca.Node(point)
            node.ndf = 6
            node.setNodeTag(AlpacaModel)
            AlpacaModel.nodes.append( node )
         
            AlpacaModel.py.append(node.write_tcl())
    
    
    
    end = time.clock() - start
    print("time to create node and assign tag {}".format(end))
    start = time.clock()
    
    
    #################
    # create supports
    #################
    
    for supportNode in Support:
        
        # if the list is empty, skip this operation
        if AlpacaModel.uniquePointsThreeNDF:
            closestPointInThreeNDF = rc.Point3dList.ClosestPointInList(AlpacaModel.uniquePointsThreeNDF, supportNode.Pos)
            if supportNode.Pos.DistanceTo(closestPointInThreeNDF) < 0.001:
                #print("I am in 3ndf")
                supportNode.ndf = 3
                AlpacaModel.threeNDFModel.append(supportNode)
                supportNode.setNodeTag(AlpacaModel)
        
        if AlpacaModel.uniquePointsSixNDF:
            closestPointInSixNDF = rc.Point3dList.ClosestPointInList(AlpacaModel.uniquePointsSixNDF, supportNode.Pos)
            if supportNode.Pos.DistanceTo(closestPointInSixNDF) < 0.001:
                supportNode.ndf = 6
                AlpacaModel.sixNDFModel.append(supportNode)
                supportNode.setNodeTag(AlpacaModel)
        
        
        AlpacaModel.supports.append(supportNode)
        AlpacaModel.py.append(supportNode.write_tcl())
    
    
    end = time.clock() - start
    print("time to create support and assign tag {}".format(end))
    start = time.clock()
    
    
    ####################
    # create constraints
    ####################
    
    
    for constraint in Constraint:
        constraint.setNodeTag(AlpacaModel)
        AlpacaModel.constraints.append(constraint)
    
    ####################
    # create equalDOF when the model has 3df and 6df together
    ####################
    
    
    end = time.clock() - start
    print("time to create constraint and assign tag {}".format(end))
    start = time.clock()
    
    
    Id = []
    IdB = []
    
    def SearchCallback(sender, e):
        Id.Add(e.Id)
        IdB.Add(e.IdB)
    
    
    
    lenThreeNDF = len(AlpacaModel.uniquePointsThreeNDF)
    lenSixNDF = len(AlpacaModel.uniquePointsSixNDF)
    
    
    if not(lenThreeNDF == 0 or lenSixNDF == 0):
        print("brick and beam together")
        rg.RTree.SearchOverlaps(AlpacaModel.RTreeCloudPointThreeNDF, AlpacaModel.RTreeCloudPointSixNDF, 0.001, SearchCallback)
        
        for i,j in zip(Id, IdB):
            print(i,j)
            node_i = AlpacaModel.uniquePointsThreeNDF[i]
            node_j = AlpacaModel.uniquePointsSixNDF[j]
            
            #index_i = AlpacaModel.cloudPoint.ClosestPoint(node_i) + 1
            #index_j = AlpacaModel.cloudPoint.ClosestPoint(node_j) + 1
            
            equalConstraint = alpaca.EqualDOF(node_i, node_j, True, True, True, False, False, False)
            equalConstraint.masterNodeTag = AlpacaModel.cloudPointThreeNDF.ClosestPoint(node_i) + 1
            equalConstraint.slaveNodesTag = AlpacaModel.cloudPointSixNDF.ClosestPoint(node_j) + 1 + len(AlpacaModel.uniquePointsThreeNDF)
            AlpacaModel.py.append(equalConstraint.write_tcl())
    
    
    
    end = time.clock() - start
    print("time to find common points between 3ndf and 6ndf {}".format(end))
    start = time.clock()
    
    ##########################
    ##########################
    ##########################
    
    crossSection = []
    material = []
    
    for item in Element:
        if item.type != "Brick":
            crossSection.append(item.CrossSection)
            material.append(item.CrossSection.material)
        else:
            material.extend(item.material)
        
    
    uniqueCS = list(set(crossSection))
    
    
    flatten_material = alpacaUtil.flatten_list(material)
    
    
    uniqueMaterial = list(set(flatten_material))
    
    for index, material in enumerate(uniqueMaterial,1):
        material.matTag = index
        AlpacaModel.py.append(material.write_tcl())
    
    
    for index, section in enumerate(uniqueCS,1):
        section.sectionTag = index
        AlpacaModel.py.append(section.write_tcl())
        
    
    
    
    
    
    # write py file
    
    
    # assign tag and node Index to element and shell
    for index, element in enumerate(Element,1):
        element.setTopologyRTree(AlpacaModel)
        element.eleTag = index
        element.setTags()
    
    
    
    end = time.clock() - start
    print("time to assign tags for the elements {}".format(end))
    start = time.clock()
    
    
    
    Mass = 0
    IsGravity = False
    g_factor = 10.00
    
    for item in Load:
        if item.type == "Gravity Load":
            IsGravity = True
            GravityLoad = item
        if item.type == "PointLoad":
            AlpacaModel.loads.append(item)
    
    
    for item in Element:
        if item.type == "Beam":
            length = item.Crv.GetLength()
            Mass += (item.massDens * length)
            if IsGravity:
                gravityPointLoad_1 = alpaca.PointLoad(item.Crv.PointAtStart, g_factor * rg.Vector3d(0,0, -(item.massDens * length / 2)) * GravityLoad.GravityFactor, rg.Vector3d(0,0,0), GravityLoad.TimeSeries)
                gravityPointLoad_2 = alpaca.PointLoad(item.Crv.PointAtEnd, g_factor * rg.Vector3d(0,0, -(item.massDens * length / 2)) * GravityLoad.GravityFactor, rg.Vector3d(0,0,0), GravityLoad.TimeSeries)
                ##print( -(item.massDens * length / 2))
                AlpacaModel.loads.append(gravityPointLoad_1)
                AlpacaModel.loads.append(gravityPointLoad_2)
        if item.type == "Shell":
            meshArea = rg.AreaMassProperties.Compute(item.Mesh).Area
            if item.CrossSection.__class__.__name__ != "LayeredShell":
                areaDensity = item.CrossSection.thickness * item.CrossSection.material.rho
                Mass += areaDensity * meshArea
                if IsGravity:
                    for vertex in item.Mesh.Vertices.ToPoint3dArray():
                        gravityPointLoad = alpaca.PointLoad(vertex, g_factor * rg.Vector3d(0,0, -(areaDensity * meshArea/ len(item.Mesh.Vertices))) * GravityLoad.GravityFactor, rg.Vector3d(0,0,0), GravityLoad.TimeSeries)
                        AlpacaModel.loads.append(gravityPointLoad)
            else:
                for thickness, material in zip(item.CrossSection.thickness, item.CrossSection.material):
                    areaDensity = thickness * material.rho
                    Mass += areaDensity * meshArea
                    if IsGravity:
                        for vertex in item.Mesh.Vertices.ToPoint3dArray():
                            gravityPointLoad = alpaca.PointLoad(vertex, g_factor * rg.Vector3d(0,0, -(areaDensity * meshArea/ len(item.Mesh.Vertices))) * GravityLoad.GravityFactor, rg.Vector3d(0,0,0), GravityLoad.TimeSeries)
                            AlpacaModel.loads.append(gravityPointLoad)


        if item.type == "Brick":
            #print(type(item.Mesh))
            meshVolume = rg.VolumeMassProperties.Compute(item.Mesh).Volume
            density = item.material.rho 
            Mass += density * meshVolume
            if IsGravity:
                for vertex in item.Mesh.Vertices.ToPoint3dArray():
                    gravityPointLoad = alpaca.PointLoad(vertex, g_factor * rg.Vector3d(0,0, -(density * meshVolume / len(item.Mesh.Vertices))) * GravityLoad.GravityFactor, rg.Vector3d(0,0,0), GravityLoad.TimeSeries)
                    #print(len(item.Mesh.Vertices))
                    #print(density)
                    # volume can be zero if mesh faces are not properly rotated
                    #print(meshVolume)
                    #print(-(density * meshVolume / len(item.Mesh.Vertices)))
                    AlpacaModel.loads.append(gravityPointLoad)
    
    #print(AlpacaModel.loads)
    ## load
    
    
    for item in AlpacaModel.loads:
        item.setNodeTag(AlpacaModel)
    
    #print(AlpacaModel.loads)
    
    for item in AlpacaModel.beams:
        AlpacaModel.py.append(item.write_tcl())
    
    for item in AlpacaModel.shells:
        AlpacaModel.py.append(item.write_tcl())
    
    for item in AlpacaModel.bricks:
        AlpacaModel.py.append(item.write_tcl())
    
    
    for item in Constraint:
        AlpacaModel.py.append(item.write_tcl())
    
    
    timeSeriesDict = alpaca.TimeSeries.getTimeSeries(AlpacaModel.loads)[1]
    AlpacaModel.py.append(alpaca.PointLoad.write_tcl(timeSeriesDict,AlpacaModel))
    
    
    text = AlpacaModel.py
# ---------- end am ----------
assemble = AssembleModelKaramba3D(Elem=linetobeam.Element, Support=supp, LimitDistance_m=0.005)  # -> Model, Info, Mass_kg, CenterOfGravity, LoadCaseNames
num = Number("3")
nv = RunNaturalVibrationAnalysisAlpaca4d(AlpacaModel=am.AlpacaModel, numberModes=num)  # -> AlpacaSolvedModel, EigenValues, Period, NaturalFrequencies; inputs numberModes: Int32
# ---------- nv: Python ----------
"""
Run an Natural Vibration Analysis
-
    Args:
        AlpacaModel:
        numberModes:
    Returns:
        AlpacaSolvedModel:
        EigenValues:
        Period:
        NaturalFrequencies:
"""



import Rhino.RhinoDoc
import Grasshopper as gh
import copy
import rhinoscriptsyntax as rs
import os
import time
import sys
import math


ghenv.Component.Name = "Run Natural Vibration Analysis (Alpaca4d)"
ghenv.Component.NickName = 'NV'
ghenv.Component.Message = "Natural Vibration Analysis (Alpaca4d)"

ghcompfolder = gh.Folders.DefaultAssemblyFolder
if ghcompfolder not in sys.path:
    sys.path.append(ghcompfolder)

try:
    from Alpaca4d import alpaca4d as alpaca
except:
    msg = "Cannot import Alpaca4d. Is the Alpaca4d folder available in " + ghcompfolder + "?"
    ghenv.Component.AddRuntimeMessage(gh.Kernel.GH_RuntimeMessageLevel.Error, msg)


checkData = True



if not AlpacaModel:
    checkData = False
    msg = "Input parameter AlpacaModel failed to collect data"
    ghenv.Component.AddRuntimeMessage(gh.Kernel.GH_RuntimeMessageLevel.Warning, msg)


if not numberModes:
    checkData = False
    msg = "Input parameter numberModes failed to collect data"
    ghenv.Component.AddRuntimeMessage(gh.Kernel.GH_RuntimeMessageLevel.Warning, msg)


if checkData:
    FolderPath = rs.DocumentPath()
    os.chdir(FolderPath)
    
    outputFileName = 'openSeesModel'
    recorderFileName = 'recorder_modes.mpco'
    
    for dirpath, dirnames, filenames in os.walk(FolderPath):
        for filename in filenames:
            if filename == outputFileName:
                file = os.path.join(dirpath,outputFileName)
                os.remove(file)
            elif filename == recorderFileName:
                file = os.path.join(dirpath,recorderFileName)
                os.remove(file)
    
    
    # create a copy
    
    AnalysisModel = copy.copy(AlpacaModel)
    AnalysisModel.py = list(AnalysisModel.py)
    
    # generate Recorder and assign name
    AnalysisModel.recorderName = "recorder_modes" + ".mpco"
    AnalysisModel.modalAnalysisReportFile = "ModalReport.txt"
    
    AnalysisModel.py.append(alpaca.TCLRecorder.mpco(AnalysisModel.recorderName, False,False,False,False,True,True,False,False,False,False))
    
    AnalysisModel.numberModes = numberModes
    
    eigen_tcl = "set lambdaN [eigen {}]".format(numberModes)
    AnalysisModel.py.append(eigen_tcl)
    
    
    AnalysisModel.py.append('puts "$lambdaN"')
    
    AnalysisModel.py.append(('modalProperties -file "{0}"  -unorm').format(AnalysisModel.modalAnalysisReportFile))
    
    AnalysisModel.py.append('record\nwipe')
    
    
    
    #textFile = AnalysisModel.py
    
    time_start = time.clock()
    
    AnalysisModel.writeFile(outputFileName)
    
    time_elapsed = (time.clock() - time_start)
    print("Writing Time {}".format(time_elapsed))
    
    
    
    time_start = time.clock()
    
    executable = os.path.join(ghcompfolder,'Alpaca4d\OpenSees-Solvers\opensees.bat')
    log, eigen = AnalysisModel.runEigen(executable)
    
    

    eigen = eigen[0].strip().split()[0:numberModes]
    
    
    EigenValues = [float(eigenValue) for eigenValue in eigen] 
    
    NaturalFrequencies = [math.sqrt(eigenValue) / (2 * math.pi) for eigenValue in EigenValues]
    Period = [1/naturalFrequency for naturalFrequency in NaturalFrequencies]
    
    AlpacaSolvedModel = copy.copy(AnalysisModel)
    AlpacaSolvedModel.isAnalysed = True
    AlpacaSolvedModel.isModal = True
# ---------- end nv ----------
nvibes = NaturalVibrationsKaramba3D(Model=assemble.Model, FromIndex=1, NumberOfModes="3", MaximumNumberOfIterations=30, Epsilon=1e-05)  # -> ModelWithVibrationModesAsLoadCaseResults, NaturalFrequencies_Hz, ModalMass_kg, ParticipationFactorInGlobalXYAndZDirection
panel = Panel(nvibes.NaturalFrequencies_Hz)
mar = ModalAnalysisReportAlpaca4d(AlpacaSolvedModel=nv.AlpacaSolvedModel)  # -> ModalAnalysis_ReportFile, EigenvalueAnalysis, TotalMassStructure, TotalFreeMassStructure, CenterOfMass, ModalParticipationFactors, ModalParticipationMasses_cumulative, ModalParticipationMassRatio, ModalParticipationMassRatio_cumulative
# ---------- mar: Python ----------
"""
Parse the modal properties file output.
The original OpenSees code has been develop by Massimo Petracca at ASDEA Software.
-
    Args:
        AlpacaSolvedModel:
    Returns:
        ModalAnalysis_ReportFile:
        
        EigenvalueAnalysis:
        
        TotalMassStructure:
        
        TotalFreeMassStructure:
        
        CenterOfMass:
        
        ModalParticipationFactors:
        
        ModalParticipationMasses:
        ModalParticipationMasses_cumulative:
        
        ModalParticipationMassRatio:
        ModalParticipationMassRatio_cumulative:
"""



import Rhino.RhinoDoc
import Grasshopper as gh
import copy
import rhinoscriptsyntax as rs
import os
import time
import sys
import math
import ghpythonlib.treehelpers as th


ghenv.Component.Name = "Modal Analysis Report (Alpaca4d)"
ghenv.Component.NickName = 'MAR'
ghenv.Component.Message = "Modal Analysis Report (Alpaca4d)"

ghcompfolder = gh.Folders.DefaultAssemblyFolder
if ghcompfolder not in sys.path:
    sys.path.append(ghcompfolder)

try:
    from Alpaca4d import alpaca4d as alpaca
except:
    msg = "Cannot import Alpaca4d. Is the Alpaca4d folder available in " + ghcompfolder + "?"
    ghenv.Component.AddRuntimeMessage(gh.Kernel.GH_RuntimeMessageLevel.Error, msg)


checkData = True


if not AlpacaSolvedModel:
    checkData = False
    msg = "Input parameter AlpacaSolvedModel failed to collect data"
    ghenv.Component.AddRuntimeMessage(gh.Kernel.GH_RuntimeMessageLevel.Warning, msg)




if checkData:
    report_file = AlpacaSolvedModel.modalAnalysisReportFile
    number_eigen = AlpacaSolvedModel.numberModes
    
    file = open(report_file)
    
    text_file = file.readlines()
    
    ModalAnalysis_ReportFile = []
    
    
    for i, line in enumerate(text_file):
        if "2. EIGENVALUE ANALYSIS" in line:
            ModalAnalysis_ReportFile.append(text_file[i:i + 4 + number_eigen] )
    
        if "3. TOTAL MASS OF THE STRUCTURE" in line:
            ModalAnalysis_ReportFile.append(text_file[i:i + 6] )
    
    
        if "4. TOTAL FREE MASS OF THE STRUCTURE" in line:
            ModalAnalysis_ReportFile.append(text_file[i:i + 6] )
    
    
        if "5. CENTER OF MASS" in line:
            ModalAnalysis_ReportFile.append(text_file[i:i+5] )
    
    
        if "6. MODAL PARTICIPATION FACTORS" in line:
            ModalAnalysis_ReportFile.append(text_file[i:i + 6 + number_eigen] )
    
    
        if "7. MODAL PARTICIPATION MASSES" in line:
            ModalAnalysis_ReportFile.append(text_file[i:i + 4 + number_eigen] )
    
    
        if "8. MODAL PARTICIPATION MASSES (cumulative)" in line:
            ModalAnalysis_ReportFile.append(text_file[i:i + 4 + number_eigen] )
    
    
        if "9. MODAL PARTICIPATION MASS RATIOS (%)" in line:
            text_temp =  ModalAnalysis_ReportFile.append(text_file[i: i + 4 + number_eigen])
        
    
        if "10. MODAL PARTICIPATION MASS RATIOS (%) (cumulative)" in line:
            text_temp =  ModalAnalysis_ReportFile.append(text_file[i: i + 4 + number_eigen])
        
        else:
            continue
    
    
    file.close()
    
    ModalAnalysis_ReportFile = th.list_to_tree(ModalAnalysis_ReportFile)
    
    EigenvalueAnalysis = ModalAnalysis_ReportFile.Branch(0)
    
    TotalMassStructure = ModalAnalysis_ReportFile.Branch(1)
    
    TotalFreeMassStructure = ModalAnalysis_ReportFile.Branch(2)
    
    CenterOfMass = ModalAnalysis_ReportFile.Branch(3)
    
    ModalParticipationFactors = ModalAnalysis_ReportFile.Branch(4)
    
    ModalParticipationMasses = ModalAnalysis_ReportFile.Branch(5)
    ModalParticipationMasses_cumulative = ModalAnalysis_ReportFile.Branch(6)
    
    ModalParticipationMassRatio = ModalAnalysis_ReportFile.Branch(7)
    ModalParticipationMassRatio_cumulative = ModalAnalysis_ReportFile.Branch(8)
# ---------- end mar ----------
panel_2 = Panel(mar.ModalParticipationMasses_cumulative)
nv_2 = RunNaturalVibrationAnalysisAlpaca4d()  # -> AlpacaSolvedModel, EigenValues, Period, NaturalFrequencies; inputs numberModes: Int32; same code as nv
num_2 = Number(0.007)
panel_3 = Panel(num_2)
sqrt = SquareRoot(Value=panel_3)
expression = Expression(xDamp="0.05", omega=sqrt, Expression="2 * xDamp / omega")
rd = RayleighDampingAlpaca4d(betaKcomm=expression)  # -> RayleighDamping
# ---------- rd: Python ----------
"""
This command is used to assign damping to all previously-defined elements and nodes. When using rayleigh damping in OpenSees, the damping matrix for an element or node, D is specified as a combination of stiffness and mass-proportional damping matrices:
D = alphaM * M + [betaKcurrent * Kcurrent] + [betaKinit * Kinit] + [betaKcomm * KlastCommit] 


xDamp = 0.05;                       # 5% damping ratio
alphaM = 0.00;                      # M-prop damping;                               alphaM*M
betaKcurrent = 0.00;                # K-proportional damping;                       beatKcurr*KCurrent
betaKinit = 0.00;                   # initial-stiffness proportional damping;       beatKinit*Kinit
betaKcomm = 2.*xDamp/omega;         # K-prop. damping parameter;                    betaKcomm*KlastCommitt


    Args:
        alphaM: factor applied to elements or nodes mass matrix
        betaKcurrent: factor applied to elements current stiffness matrix.
        betaKinit: factor applied to elements initial stiffness matrix.
        betaKcomm: factor applied to elements committed stiffness matrix. 
    Returns:
        RayleighDamping:
"""

ghenv.Component.Name = "Rayleigh Damping (Alpaca4d)"
ghenv.Component.NickName = 'RD'
ghenv.Component.Message = "Rayleigh Damping (Alpaca4d)"


import sys
import Rhino.Geometry as rg
import Grasshopper as gh
import ghpythonlib.components as ghcomp
from System.Drawing import Color

## add alpaca install directory to system path

ghcompfolder = gh.Folders.DefaultAssemblyFolder
if ghcompfolder not in sys.path:
    sys.path.append(ghcompfolder)

try:
    from Alpaca4d import alpaca4d as alpaca
except:
    msg = "Cannot import Alpaca4d. Is the Alpaca4d folder available in " + ghcompfolder + "?"
    ghenv.Component.AddRuntimeMessage(gh.Kernel.GH_RuntimeMessageLevel.Error, msg)


checkData = True

if not betaKcomm:
    checkData = False
    msg = "Input parameter betaKcomm failed to collect data"
    ghenv.Component.AddRuntimeMessage(gh.Kernel.GH_RuntimeMessageLevel.Warning, msg)


alphaM = 0.0 if alphaM is None else alphaM
betaKcurrent = 0.0 if betaKcurrent is None else betaKcurrent
betaKinit = 0.0 if betaKinit is None else betaKinit


if checkData:
    RayleighDamping = alpaca.Rayleigh_Damping(alphaM, betaKcurrent, betaKinit, betaKcomm)
# ---------- end rd ----------
as = AnalysesStepsAlpaca4d(numIncr="1")  # -> AnalysisSteps; inputs numIncr: Int32
# ---------- as: Python ----------
"""
Define the Analysis Step
-
    Inputs:
        numIncr:
        dt:
        dtMin:
        dtMAx:
        Jd:
    Output:
        AnalysisSteps:
"""



ghenv.Component.Name = "Analyses Steps (Alpaca4d)"
ghenv.Component.NickName = 'AS'
ghenv.Component.Message = "Analyses Steps (Alpaca4d)"
ghenv.Component.IconDisplayMode = ghenv.Component.IconDisplayMode.application
ghenv.Component.Category = "Alpaca4d"
ghenv.Component.SubCategory = "7_Analysis"



import sys
import Rhino.Geometry as rg
import Grasshopper as gh
import ghpythonlib.components as ghcomp
from System.Drawing import Color

## add alpaca install directory to system path

ghcompfolder = gh.Folders.DefaultAssemblyFolder
if ghcompfolder not in sys.path:
    sys.path.append(ghcompfolder)

try:
    from Alpaca4d import alpaca4d as alpaca
except:
    msg = "Cannot import Alpaca4d. Is the Alpaca4d folder available in " + ghcompfolder + "?"
    ghenv.Component.AddRuntimeMessage(gh.Kernel.GH_RuntimeMessageLevel.Error, msg)

dt = "" if dt is None else dt
dtMin = "" if dtMin is None else dtMin
dtMax = "" if dtMax is None else dtMax
Jd = "" if Jd is None else Jd

checkData = True

if not numIncr:
    checkData = False
    msg = "Input parameter numIncr failed to collect data"
    ghenv.Component.AddRuntimeMessage(gh.Kernel.GH_RuntimeMessageLevel.Warning, msg)

if checkData:
    AnalysisSteps = alpaca.AnalysisSteps(numIncr, dt, dtMin, dtMax, Jd)
# ---------- end as ----------
as_2 = AnalysisSettingsAlpaca4d(Damping=rd, AnalysisType="Transient", AnalysisSteps=as)  # -> out, Settings
# ---------- as_2: Python ----------
"""
Create Analysis settings
-
    Args:
        Damping: 
        Constraint: 'Plain', 'Transformation'. Default is 'Transformation'.
        Numberer: 'RCM', 'AMD', 'Plain'. Default is 'RCM'.
        System: 'BandGen', 'BandSPD', 'ProfileSPD', 'SuperLU', 'UmfPack', 'FullGeneral', 'SparseSYM'. Default is 'BandSPD'.
        Test: Feature not implemented. Please contact alpaca4d@gmail.com 
        Algorithm: 'Linear', 'Newton', 'NewtonLineSearch', 'ModifiedNewton', 'KrylovNewton', 'SecantNewton', 'BFGS', 'Broyden'. Default is 'Linear'.
        Integrator: Default is LoadControl.
        AnalysisType: 'Static', 'Transient'. Default is 'Static'.
        AnalyesSteps:
    Returns:
        Analysis:
"""

import sys
import os


import clr
import clrtype
import Rhino.Geometry as rg
import rhinoscriptsyntax as rs
import Grasshopper as gh
import copy
import ghpythonlib.treehelpers as th


ghenv.Component.Name = "Analysis settings (Alpaca4d)"
ghenv.Component.NickName = 'AS'
ghenv.Component.Message = "Analysis settings \n(Alpaca4d)"



from Alpaca4d import alpaca4d as alpaca

checkData = True



Damping = None if Damping is None else Damping


# default Value
Constraint = 'Transformation' if Constraint is None else Constraint
ConstraintList = ['Plain', 'Transformation']

for item in ConstraintList:
    if Constraint.lower() == item.lower():
        Constraint = item


# default Value
Numberer = 'RCM' if Numberer is None else Numberer
NumbererList = ['RCM', 'AMD', 'Plain', 'ParallelPlain', 'ParallelRCM']

for i,item in enumerate(NumbererList):
    if Numberer.lower() == item.lower():
        Numberer = item



# default Value
System = 'BandSPD' if System is None else System
SystemList = ['BandGen', 'BandSPD', 'ProfileSPD', 'SuperLU', 'UmfPack', 'FullGeneral', 'SparseSYM']

for i,item in enumerate(SystemList):
    if System.lower() == item.lower():
        System = item


# default Test
Test = 'NormDispIncr 1.0e-6 12 5' if Test is None else Test




# default Value
Algorithm = 'Linear' if Algorithm is None else Algorithm
AlgorithmList = ['Linear', 'Newton', 'NewtonLineSearch', 'ModifiedNewton', 'KrylovNewton', 'SecantNewton', 'BFGS', 'Broyden']

for i,item in enumerate(AlgorithmList):
    if Algorithm.lower() == item.lower():
        Algorithm = item


# default Value
AnalysisType = 'Static' if AnalysisType is None else AnalysisType
AnalysisTypeList = ['Static', 'Transient']

for item in AnalysisTypeList:
    if AnalysisType.lower() == item.lower():
        AnalysisType = item



## Define Integrator
if AnalysisType == "Static":
    Integrator = "LoadControl 1.0" if Integrator is None else Integrator
elif AnalysisType == "Transient":
    Integrator = "Newmark 0.5 0.25" if Integrator is None else Integrator


if AnalysisType == 'Transient':
    if not Damping:
        checkData = False
        msg = "Input parameter Damping failed to collect data"
        ghenv.Component.AddRuntimeMessage(gh.Kernel.GH_RuntimeMessageLevel.Warning, msg)


if not AnalysisSteps:
    checkData = False
    msg = "Input parameter AnalysisSteps failed to collect data"
    ghenv.Component.AddRuntimeMessage(gh.Kernel.GH_RuntimeMessageLevel.Warning, msg)




if checkData:
    Settings = alpaca.Analysis(Constraint, Numberer, System, Test, Algorithm, Integrator, AnalysisType, AnalysisSteps, Damping)
    print(Settings.write_tcl())
# ---------- end as_2 ----------
panel_4 = Panel(as_2.out)
ra = RunAnalysisAlpaca4d(Settings=as_2.Settings)  # -> log, AlpacaSolvedModel
# ---------- ra: Python ----------
"""
Run an OpenSees Analysis
-
    Args:
        AlpacaModel:
        Settings:
    Returns:
        AlpacaSolvedModel:
"""



import Rhino.RhinoDoc
import Grasshopper as gh
import copy
import rhinoscriptsyntax as rs
import os
import time
import sys



ghenv.Component.Name = "Run Analysis (Alpaca4d)"
ghenv.Component.NickName = 'RA'
ghenv.Component.Message = "Run Analysis (Alpaca4d)"

ghcompfolder = gh.Folders.DefaultAssemblyFolder
if ghcompfolder not in sys.path:
    sys.path.append(ghcompfolder)

try:
    from Alpaca4d import alpaca4d as alpaca
except:
    msg = "Cannot import Alpaca4d. Is the Alpaca4d folder available in " + ghcompfolder + "?"
    ghenv.Component.AddRuntimeMessage(gh.Kernel.GH_RuntimeMessageLevel.Error, msg)


checkData = True



if not AlpacaModel:
    checkData = False
    msg = "Input parameter AlpacaModel failed to collect data"
    ghenv.Component.AddRuntimeMessage(gh.Kernel.GH_RuntimeMessageLevel.Warning, msg)


if not Settings:
    checkData = False
    msg = "Input parameter Settings failed to collect data"
    ghenv.Component.AddRuntimeMessage(gh.Kernel.GH_RuntimeMessageLevel.Warning, msg)


if checkData:
    FolderPath = rs.DocumentPath()
    os.chdir(FolderPath)
    
    outputFileName = 'openSeesModel'
    recorderFileName = 'recorder.mpco'
    
    for dirpath, dirnames, filenames in os.walk(FolderPath):
        for filename in filenames:
            if filename == outputFileName:
                file = os.path.join(dirpath,outputFileName)
                os.remove(file)
            elif filename == recorderFileName:
                file = os.path.join(dirpath,recorderFileName)
                os.remove(file)
    
    
    # create a copy
    
    AnalysisModel = copy.copy(AlpacaModel)
    AnalysisModel.py = list(AnalysisModel.py)
    
    # generate Recorder and assign name
    AnalysisModel.recorderName = "recorder" + ".mpco"
    
    AnalysisModel.py.append(alpaca.TCLRecorder.mpco(AnalysisModel.recorderName, True,True,True,True,False,False,True,True,True,True))
    
    
    AnalysisModel.analysis = Settings
    AnalysisModel.py.append(Settings.write_tcl())
    AnalysisModel.py.append("wipe")
    
    
    #textFile = AnalysisModel.py
    
    time_start = time.clock()
    
    AnalysisModel.writeFile(outputFileName)
    
    time_elapsed = (time.clock() - time_start)
    print("Writing Time {}".format(time_elapsed))
    
    
    
    time_start = time.clock()
    
    executable = os.path.join(ghcompfolder,'Alpaca4d\OpenSees-Solvers\opensees.bat')
    a, log = AnalysisModel.runOpensees(executable)
    
    
    time_elapsed = (time.clock() - time_start)
    print("Analyses Time {}".format(time_elapsed))
    
    AlpacaSolvedModel = copy.copy(AnalysisModel)
    AlpacaSolvedModel.isAnalysed = True
# ---------- end ra ----------
