# Grasshopper definition uniformExcitation.gh (Grasshopper 1.0.7)

cts = ConstantTimeSeriesAlpaca4d()  # -> TimeSeries, Graph
# ---------- cts: Python ----------
"""
Create a Constant Time Series
-
    Args:
        tStart:
        tEnd:
        period:
        factor:
        shift:
    Returns:
        TimeSeries:
        Graph:
"""

ghenv.Component.Name = "Constant Time Series (Alpaca4d)"
ghenv.Component.NickName = 'CTS'
ghenv.Component.Message = "Constant Time Series (Alpaca4d)"


import sys
import Rhino.Geometry as rg
import Grasshopper as gh
import copy
import math


## add alpaca install directory to system path

ghcompfolder = gh.Folders.DefaultAssemblyFolder
if ghcompfolder not in sys.path:
    sys.path.append(ghcompfolder)

try:
    from Alpaca4d import alpaca4d as alpaca
except:
    msg = "Cannot import Alpaca4d. Is the Alpaca4d folder available in " + ghcompfolder + "?"
    ghenv.Component.AddRuntimeMessage(gh.Kernel.GH_RuntimeMessageLevel.Error, msg)

def ConstantSeries(x):
    return x



checkData = True

if not constantFactor:
    constantFactor = 1


if checkData:
    TimeSeries = alpaca.TimeSeriesConstant(constantFactor)
    
    Graph = []
    
    for x in range(10):
        Graph.append(ConstantSeries(constantFactor))
# ---------- end cts ----------
pl = PointLoadAlpaca4d()  # -> out, Load; inputs Pos: Point3d, Force: Vector3d, Moment: Vector3d
# ---------- pl: Python ----------
"""
Create a Point Load
-
    Args:
        Pos:
        Force:
        Moment:
        TimeSeries:
    Returns:
        PointLoad:
"""

ghenv.Component.Name = "Point Load (Alpaca4d)"
ghenv.Component.NickName = 'PL'
ghenv.Component.Message = "Point Load (Alpaca4d)"



import sys
import Rhino.Geometry as rg
import Grasshopper as gh
import copy


## add alpaca install directory to system path

ghcompfolder = gh.Folders.DefaultAssemblyFolder
if ghcompfolder not in sys.path:
    sys.path.append(ghcompfolder)

try:
    from Alpaca4d import alpaca4d as alpaca
except:
    msg = "Cannot import Alpaca4d. Is the Alpaca4d folder available in " + ghcompfolder + "?"
    ghenv.Component.AddRuntimeMessage(gh.Kernel.GH_RuntimeMessageLevel.Error, msg)


checkData = True

if not Pos:
    checkData = False
    msg = "Input parameter Pos failed to collect data"
    ghenv.Component.AddRuntimeMessage(gh.Kernel.GH_RuntimeMessageLevel.Warning, msg)

if not Force:
    Force = rg.Vector3d(0,0,0)

if not Moment:
    Moment = rg.Vector3d(0,0,0)

if not TimeSeries:
    checkData = False
    msg = "Input parameter TimeSeries failed to collect data"
    ghenv.Component.AddRuntimeMessage(gh.Kernel.GH_RuntimeMessageLevel.Warning, msg)


if checkData:
    Load = alpaca.PointLoad(Pos, Force, Moment, TimeSeries)
# ---------- end pl ----------
panel = Panel("2")
ue = UniformExcitationAlpaca4d()  # -> Load
# ---------- ue: Python ----------
"""
Create an Uniform Excitation Object
-
    Args:
        Direction:
        TimeSeries:
    Returns:
        Load:
"""

ghenv.Component.Name = "Uniform Excitation (Alpaca4d)"
ghenv.Component.NickName = 'UE'
ghenv.Component.Message = "Uniform Excitation (Alpaca4d)"


import sys
import Rhino.Geometry as rg
import Grasshopper as gh
import copy
import math


## add alpaca install directory to system path

ghcompfolder = gh.Folders.DefaultAssemblyFolder
if ghcompfolder not in sys.path:
    sys.path.append(ghcompfolder)

try:
    from Alpaca4d import alpaca4d as alpaca
except:
    msg = "Cannot import Alpaca4d. Is the Alpaca4d folder available in " + ghcompfolder + "?"
    ghenv.Component.AddRuntimeMessage(gh.Kernel.GH_RuntimeMessageLevel.Error, msg)

if not Direction:
    checkData = False
    msg = "Input parameter Direction failed to collect data"
    ghenv.Component.AddRuntimeMessage(gh.Kernel.GH_RuntimeMessageLevel.Warning, msg)


if not TimeSeries:
    checkData = False
    msg = "Input parameter TimeSeries failed to collect data"
    ghenv.Component.AddRuntimeMessage(gh.Kernel.GH_RuntimeMessageLevel.Warning, msg)

if checkData:
    Load = alpaca.UniformExcitation(Direction,TimeSeries)
# ---------- end ue ----------
pl_2 = PointLoadAlpaca4d()  # -> out, Load; inputs Pos: Point3d, Force: Vector3d, Moment: Vector3d; same code as pl
uem = UniaxialElasticMaterialAlpaca4d()  # -> out, uniAxialMaterial
# ---------- uem: Python ----------
"""
Create a uniaxial Elastic Material
-
    Args:
        E:
        Eneg:
        eta:
        G:
        v:
        rho:
    Returns:
        uniAxialMaterial:
"""

ghenv.Component.Name = "uniaxial Elastic Material (Alpaca4d)"
ghenv.Component.NickName = 'UEM'
ghenv.Component.Message = "uniaxial Elastic (Alpaca4d)"

import sys
import Rhino.Geometry as rg
import Grasshopper as gh
import copy


## add alpaca install directory to system path

ghcompfolder = gh.Folders.DefaultAssemblyFolder
if ghcompfolder not in sys.path:
    sys.path.append(ghcompfolder)

try:
    from Alpaca4d import alpaca4d as alpaca
except:
    msg = "Cannot import Alpaca4d. Is the Alpaca4d folder available in " + ghcompfolder + "?"
    ghenv.Component.AddRuntimeMessage(gh.Kernel.GH_RuntimeMessageLevel.Error, msg)


checkData = True

if not E:
    checkData = False
    msg = "Input parameter E failed to collect data"
    ghenv.Component.AddRuntimeMessage(gh.Kernel.GH_RuntimeMessageLevel.Warning, msg)

if not G and not v:
    checkData = False
    msg = "Input parameter G or v failed to collect data"
    ghenv.Component.AddRuntimeMessage(gh.Kernel.GH_RuntimeMessageLevel.Warning, msg)

if not rho:
    checkData = False
    msg = "Input parameter rho failed to collect data"
    ghenv.Component.AddRuntimeMessage(gh.Kernel.GH_RuntimeMessageLevel.Warning, msg)



if checkData:
    uniAxialMaterial = alpaca.uniAxialMaterialElastic(name, E, Eneg, eta, G, v, rho)
# ---------- end uem ----------
rs = RectangularSectionAlpaca4d()  # -> out, Section
# ---------- rs: Python ----------
"""
Create a Rectangular Cross Section
-
    Args:
        secName:
        Area:
        Izz:
        Iyy:
        J:
        alphaY:
        alphaZ:
        material:
    Returns:
        Section:
"""
ghenv.Component.Name = "Rectangular Section (Alpaca4d)"
ghenv.Component.NickName = 'RS'
ghenv.Component.Message = "Rectangular Section (Alpaca4d)"

import sys
import Rhino.Geometry as rg
import Grasshopper as gh
import copy


## add alpaca install directory to system path

ghcompfolder = gh.Folders.DefaultAssemblyFolder
if ghcompfolder not in sys.path:
    sys.path.append(ghcompfolder)

try:
    from Alpaca4d import alpaca4d as alpaca
except:
    msg = "Cannot import Alpaca4d. Is the Alpaca4d folder available in " + ghcompfolder + "?"
    ghenv.Component.AddRuntimeMessage(gh.Kernel.GH_RuntimeMessageLevel.Error, msg)


checkData = True

if not b:
    checkData = False
    msg = "Input parameter b failed to collect data"
    ghenv.Component.AddRuntimeMessage(gh.Kernel.GH_RuntimeMessageLevel.Warning, msg)

if not h:
    checkData = False
    msg = "Input parameter h failed to collect data"
    ghenv.Component.AddRuntimeMessage(gh.Kernel.GH_RuntimeMessageLevel.Warning, msg)

if not material:
    checkData = False
    msg = "Input parameter material failed to collect data"
    ghenv.Component.AddRuntimeMessage(gh.Kernel.GH_RuntimeMessageLevel.Warning, msg)



if checkData:
    Section = alpaca.RectangularCS(secName, b,h,material)
# ---------- end rs ----------
python = GhPythonScript()  # -> out, timber_properties
# ---------- python: Python ----------
import sys
import Rhino.Geometry as rg
import Grasshopper as gh
import copy


## add alpaca install directory to system path

ghcompfolder = gh.Folders.DefaultAssemblyFolder
if ghcompfolder not in sys.path:
    sys.path.append(ghcompfolder)

try:
    from Alpaca4d import alpaca4d as alpaca
except:
    msg = "Cannot import Alpaca4d. Is the Alpaca4d folder available in " + ghcompfolder + "?"
    ghenv.Component.AddRuntimeMessage(gh.Kernel.GH_RuntimeMessageLevel.Error, msg)



# importing the module
import json
from Alpaca4d.bunch import Bunch

# Opening JSON file
with open(r"C:\Users\Marco\Desktop\timber_properties.json", 'r') as json_file:
    timberProperties = json.load(json_file)


timber_properties = timberProperties[Timber_Class]


for k,v in timber_properties.items():
    print("{}: {}".format(k,v))
# ---------- end python ----------
panel_2 = Panel(python.out)
# Timber
list = ValueList({"C14", "C16"}, selected="C16")
python_2 = GhPythonScript(Class=list)  # -> out, timber_properties
# ---------- python_2: Python ----------
import sys
import Rhino.Geometry as rg
import Grasshopper as gh
import copy


## add alpaca install directory to system path

ghcompfolder = gh.Folders.DefaultAssemblyFolder
if ghcompfolder not in sys.path:
    sys.path.append(ghcompfolder)

try:
    from Alpaca4d import alpaca4d as alpaca
except:
    msg = "Cannot import Alpaca4d. Is the Alpaca4d folder available in " + ghcompfolder + "?"
    ghenv.Component.AddRuntimeMessage(gh.Kernel.GH_RuntimeMessageLevel.Error, msg)



# importing the module
import json
from Alpaca4d.bunch import Bunch

# Opening JSON file
with open(r"C:\Users\Marco\Desktop\timber_properties.json", 'r') as json_file:
    timber_properties = json.load(json_file)


class Struct:
    def __init__(self, **entries):
        self.__dict__.update(entries)
        
    def ToString(self):
        return "custom class"
    
    def __repr__(self):
        return " "


timber_properties = Struct(**timber_properties)


#print(getattr(timber_properties,Class) )


for k,v in getattr(timber_properties,Class).items():
    print("{}: {}".format(k,v))
# ---------- end python_2 ----------
python_3 = GhPythonScript(x=python_2.timber_properties)  # -> out, a
# ---------- python_3: Python ----------
print(x.__dict__)


#print( x.C14['fm_k'])
# ---------- end python_3 ----------
panel_3 = Panel(python_2.out)
panel_4 = Panel(python_3.out)
