# Grasshopper definition text to Model.gh (Grasshopper 1.0.7)
# plug-ins: Human

# Format Engineers CAD Information Issue Disclaimer
# 
# Project: PROJECT NAME
# 
# You should use this model for reference purposes only to assist in co-ordinating your work and is supplementary to formally issued drawings. Once the data is introduced into your own CAD or other system Format Engineers Ltd. can take no responsibility for its accuracy.
# 
# The last set of formally issued paper drawings are the contractual documents which represent the current stage of design development. If you have any queries, please contact the project CAD co-ordinator or the CAD Development Team.
# 
# Changes:
# 
# YYYY-MM-DD: Summary of changes
# 
# Usage notes:
# 
# This definition includes a basic implementation of Merbarki's Farthest Point Seeding algorithm (2005), adapted for tracing lines of principal curvature on NURBS surfaces. Requires modified Triangle.NET, if this isn't attached then... good luck! There are currently two main limitations: (a) this implementation measures density in parameter space, and (b) it doesn't include the dynamic refinement of density that Mebarki suggests.
panel = Panel("C:\GitHub\Alpaca4d\Dev\textToModel_Dev\py")
dir = DirectoryContents(FolderPath=panel, Filter="*", IncludeSubfolders=False)  # -> FilePaths, FileNames
dir_2 = DirectoryContents(FolderPath="C:\GitHub\Alpaca4d\Dev\textToModel_Dev\tcl", Filter="*", IncludeSubfolders=False)  # -> FilePaths, FileNames
merge = Merge(Data1=dir.FilePaths, Data2=dir_2.FilePaths)
item = ListItem(List=merge, Index=Slider(5, range=0..5), Wrap=True)
txtmdl = TextToModelAlpaca4d(path=item)  # -> out, nodes, lines, shells, bricks, supports, Constraints
# ---------- txtmdl: Python ----------
"""
Parse an OpenSees file
-
    Args:
        Path:
    Returns:
        nodes:
        lines:
        shells:
        bricks:
        loads:
"""

ghenv.Component.Name = "Text to Model (Alpaca4d)"
ghenv.Component.NickName = 'TXTMDL'
ghenv.Component.Message = "TextToModel (Alpaca4d)"



import os
import sys
import collections
import re

import Rhino.Geometry as rg
import Grasshopper as gh


checkData = True

if not path:
    checkData = False
    msg = "Input parameter path failed to collect data"
    ghenv.Component.AddRuntimeMessage(gh.Kernel.GH_RuntimeMessageLevel.Warning, msg)


if checkData:

    fileType = os.path.splitext(path)[1]
    
    with open(path) as f:
        f.readline()
        file = []
        for line in f:
            file.append(line)
    
    
    # list with the implementedObject
    monoDimensionalObject = ["truss","corotTruss", "elasticBeamColumn","ElasticTimoshenkoBeam","dispBeamColumn","forceBeamColumn","twoNodeLink"]
    biDimensionalObject = ["ShellMITC4","ASDShellQ4","quad","ShellDKGQ","ShellNLDKGQ"]
    triDimensionalObject = ["SSPbrick","stdBrick"]
    
    
    nodeDict = collections.OrderedDict()
    supports = []
    constraints = []
    stickElement = collections.OrderedDict()
    shellElement = collections.OrderedDict()
    brickElement = collections.OrderedDict()
    
    
    # iterate over the text file
    
    for line in file:
        if fileType == ".py":
            line = line.replace(" ", "")        # remove whitespace from the python script
            line = line.replace("'","")         # remove '' from the python script
            line = line.replace('"',"")         # remove "" from the python script
            split = re.split("[(,)]", line.strip())
        elif fileType == ".tcl":
            split = line.strip().split(sep = " ")
        
        #print(split)
        
        if re.search("node",split[0]):
            index = int(split[1])
            nodeDict[index] = rg.Point3d(float(split[2]), float(split[3]), float(split[4]))
    
    
    
        if re.search("fix",split[0]):
            index = int(split[1])
            supports.append(nodeDict[index])
        
        
        
        
        elif re.search("element",split[0]):
            #print(split)
            if split[1] in monoDimensionalObject:
                index = int(split[2])
                start = int(split[3]) 
                end = int(split[4])
                startPoint = nodeDict[start]
                endPoint = nodeDict[end]
                stickElement[index] = rg.LineCurve(startPoint, endPoint)
    
    
            elif split[1] in biDimensionalObject:
                index = int(split[2])
                nodeId = [int(x) for x in split[3:7]]
                flatMesh = rg.Mesh()
                for id in nodeId:
                    flatMesh.Vertices.Add(nodeDict[id])
                flatMesh.Faces.AddFace(0, 1, 2, 3)
                shellElement[index] = flatMesh
    
    
            elif split[1] == "ShellDKGT" or split[1] == "ShellNLDKGT":
                index = int(split[2])
                nodeId = [int(x) for x in split[3:6]]
                flatMesh = rg.Mesh()
                for id in nodeId:
                    flatMesh.Vertices.Add(nodeDict[id])
                flatMesh.Faces.AddFace(0, 1, 2)
                shellElement[index] = flatMesh
    
    
    
            elif split[1] in triDimensionalObject:
                index = int(split[2])
                nodeId = [int(x) for x in split[3:11]]
                solidMesh = rg.Mesh()
                for id in nodeId:
                    solidMesh.Vertices.Add(nodeDict[id])
                solidMesh.Faces.AddFace(0, 1, 2, 3)
                solidMesh.Faces.AddFace(4, 5, 6, 7)
                solidMesh.Faces.AddFace(1, 2, 6, 5)
                solidMesh.Faces.AddFace(4, 7, 3, 0)
                solidMesh.Faces.AddFace(0, 1, 5, 4)
                solidMesh.Faces.AddFace(2, 3, 7, 6)
                brickElement[index] = solidMesh
    
    
    indexes = []
    nodes = []
    lines = []
    shells = []
    bricks = []
    
    for index, point in nodeDict.items():
        nodes.append(point)
    
    for index, line in stickElement.items():
        lines.append(line)
    
    for index, shell in shellElement.items():
        shells.append(shell)
    
    for index, brick in brickElement.items():
        bricks.append(brick)
    
    
    
    
    
    """
    joinedMesh = rg.Mesh()
    joinedMesh.Append(shells)
    
    shells = joinedMesh
    """
# ---------- end txtmdl ----------
geo = Geometry([txtmdl.shells, txtmdl.bricks])
geo_2 = Geometry(txtmdl.supports)
