# Grasshopper definition icon Test.gh (Grasshopper 1.0.7)

python = GhPythonScript()  # -> out, a
# ---------- python: Python ----------
a = None
# ---------- end python ----------
python_2 = GhPythonScript()  # -> out, a; same code as python
python_3 = GhPythonScript()  # -> out, a; same code as python
python_4 = GhPythonScript()  # -> out, a; same code as python
python_5 = GhPythonScript()  # -> out, a; same code as python
python_6 = GhPythonScript()  # -> out, a; same code as python
python_7 = GhPythonScript()  # -> out, a; same code as python
python_8 = GhPythonScript()  # -> out, a; same code as python
python_9 = GhPythonScript()  # -> out, a; same code as python
python_10 = GhPythonScript()  # -> out, a; same code as python
python_11 = GhPythonScript()  # -> out, a; same code as python
python_12 = GhPythonScript()  # -> out, a; same code as python
python_13 = GhPythonScript()  # -> out, a; same code as python
python_14 = GhPythonScript()  # -> out, a; same code as python
python_15 = GhPythonScript()  # -> out, a; same code as python
python_16 = GhPythonScript()  # -> out, a; same code as python
python_17 = GhPythonScript()  # -> out, a; same code as python
python_18 = GhPythonScript()  # -> out, a; same code as python
