# Grasshopper definition icons Together.gh (Grasshopper 1.0.7)

# ---- group: Element
data = Data(0)
data_2 = Data(0)

# ---- group: Load
data_3 = Data(0)
data_4 = Data(0)

# ---- group: Cross-Section
data_5 = Data(0)
data_6 = Data(0)

# ---- group: Support
data_7 = Data(0)
data_8 = Data(0)

# ---- group: Material
data_9 = Data(0)
data_10 = Data(0)

# ---- group: Constraint
data_11 = Data(0)
# Model 4
# Model 5
data_12 = Data(0)

# ----
python = GhPythonScript(matName="S275", E="210000", G="80760", rho="75", fy="35")  # -> uniaxialMaterial
# ---------- python: Python ----------
"""Generate a uniaxial Elastic Material
    Inputs:
        matName: Name of the material.
        E: Young's Modulus [MPa].
        G: Tangential Modulus [MPa].
        v: Poisson ratio.
        rho: specific weight [kN/m3].
        fy: Yield stress value of the material [MPa]
    Output:
       uniaxialMaterial: Material element.
       """


import Grasshopper as gh

def ElasticMaterial(matName, E, G, v, rho, fy):

    E = E * 1000                               # Input value in N/mm2 ---> Output kN/m2
    if v == None:
    	G = G * 1000                           # Input value in N/mm2 ---> Output kN/m2
    	v = (E / (2 * G)) - 1
    else:
    	G = E / (2 * (1 + v))

    rho = rho                                  # Input value kN/m3
    
    fy = fy                                    # Input value in N/mm2
    materialDimension = "uniaxialMaterial"
    materialType = "Elastic"
    matName = matName + "_" + materialDimension + "_" + materialType
    
    return [[matName, E, G, v, rho, fy, materialType]]

checkData = True

if matName is None:
    checkData = False
    msg = "input 'matName' failed to collect data"
    ghenv.Component.AddRuntimeMessage(gh.Kernel.GH_RuntimeMessageLevel.Warning, msg)

if E is None:
    checkData = False
    msg = "input 'E' failed to collect data"
    ghenv.Component.AddRuntimeMessage(gh.Kernel.GH_RuntimeMessageLevel.Warning, msg)

if G is None and v is None:
    checkData = False
    msg = "input 'G' or 'v' failed to collect data"
    ghenv.Component.AddRuntimeMessage(gh.Kernel.GH_RuntimeMessageLevel.Warning, msg)


if rho is None:
    checkData = False
    msg = "input 'rho' failed to collect data"
    ghenv.Component.AddRuntimeMessage(gh.Kernel.GH_RuntimeMessageLevel.Warning, msg)


if checkData != False:
    uniaxialMaterial = ElasticMaterial(matName, E, G, v, rho, fy)
# ---------- end python ----------
python_2 = GhPythonScript(matName="S275", E="210000", G="80760", rho="75", fy="35")  # -> nDMaterial
# ---------- python_2: Python ----------
"""Generate a n-Dimensional Elastic Isotropic Material
    Inputs:
        matName: Name of the material.
        E: Young's Modulus [MPa].
        G: Tangential Modulus [MPa].
        v: Poisson ratio.
        rho: specific weight [kN/m3].
        fy: Yield stress value of the material [MPa]
    Output:
       nDMaterial: Material element.
       """


import Grasshopper as gh

def ElasticMaterial(matName, E, G, v, rho, fy):

    E = E * 1000                               # Input value in N/mm2 ---> Output kN/m2
    if v == None:
    	G = G * 1000                           # Input value in N/mm2 ---> Output kN/m2
    	v = (E / (2 * G)) - 1
    else:
    	G = E / (2 * (1 + v))

    rho = rho                                  # Force Density
    fy = fy                                    # Input value in N/mm2
    materialDimension = "nDMaterial"
    materialType = "ElasticIsotropic"
    matName = matName + "_" + materialDimension + "_" + materialType

    return [[matName, E, G, v, rho, fy, materialType]]

checkData = True

if matName is None:
    checkData = False
    msg = "input 'matName' failed to collect data"
    ghenv.Component.AddRuntimeMessage(gh.Kernel.GH_RuntimeMessageLevel.Warning, msg)

if E is None:
    checkData = False
    msg = "input 'E' failed to collect data"
    ghenv.Component.AddRuntimeMessage(gh.Kernel.GH_RuntimeMessageLevel.Warning, msg)


if G is None and v is None:
    checkData = False
    msg = "input 'G' or 'v' failed to collect data"
    ghenv.Component.AddRuntimeMessage(gh.Kernel.GH_RuntimeMessageLevel.Warning, msg)


if rho is None:
    checkData = False
    msg = "input 'rho' failed to collect data"
    ghenv.Component.AddRuntimeMessage(gh.Kernel.GH_RuntimeMessageLevel.Warning, msg)


if checkData != False:
    nDMaterial = ElasticMaterial(matName, E, G, v, rho, fy)
# ---------- end python_2 ----------
python_3 = GhPythonScript(sectionName="RHS", base="300", height="300", uniaxialMaterial=null)  # -> CrossSection
# ---------- python_3: Python ----------
"""Generate a Rectangular cross section
    Inputs:
        sectionName: Name of the section.
        base: Base of cross section [mm].
        height: Height of cross section [mm].
        uniaxialMaterial: Material element.
    Output:
       CrossSection: CrossSection element.
       """


import math
import Grasshopper as gh

def RectangularCrossSection(sectionName, base, height, uniaxialMaterial):
    
    sectionName = sectionName
    shape = "rectangular"
    base = base / 1000                      # Input value in mm ---> Output m
    height = height / 1000                  # Input value in mm ---> Output m
    Area = base * height
    Ay = Area * 5/6
    Az = Area * 5/6
    Iyy = base*pow(height,3)/12
    Izz = pow(base,3)*height/12
    if height < base:
        k = 1 / (3+4.1*pow((height/base),3/2))
        J = k*base*pow(height,3)
    else:
        k = 1 / (3+4.1*pow((base/height),3/2))
        J = k*height*pow(base,3)
    material = uniaxialMaterial

    return [[Area, Ay, Az, Iyy, Izz, J, material, [shape, base, height], sectionName ]]

checkData = True

if sectionName is None:
    checkData = False
    msg = "input 'sectionName' failed to collect data"
    ghenv.Component.AddRuntimeMessage(gh.Kernel.GH_RuntimeMessageLevel.Warning, msg)

if base is None:
    checkData = False
    msg = "input 'base' failed to collect data"
    ghenv.Component.AddRuntimeMessage(gh.Kernel.GH_RuntimeMessageLevel.Warning, msg)

if height is None:
    checkData = False
    msg = "input 'height' failed to collect data"
    ghenv.Component.AddRuntimeMessage(gh.Kernel.GH_RuntimeMessageLevel.Warning, msg)

if uniaxialMaterial is None:
    checkData = False
    msg = "input 'uniaxialMaterial' failed to collect data"
    ghenv.Component.AddRuntimeMessage(gh.Kernel.GH_RuntimeMessageLevel.Warning, msg)

if checkData != False:
    CrossSection = RectangularCrossSection(sectionName, base, height, uniaxialMaterial)
# ---------- end python_3 ----------
python_4 = GhPythonScript(sectionName="CHS", diameter="400", thickness="40")  # -> CrossSection
#   port sectionName: Name of the section.
# ---------- python_4: Python ----------
a =2
# ---------- end python_4 ----------
python_5 = GhPythonScript()  # -> CrossSection
# ---------- python_5: Python ----------
a = 2
# ---------- end python_5 ----------
python_6 = GhPythonScript()  # -> CrossSection; same code as python_4
python_7 = GhPythonScript()  # -> CrossSection; same code as python_5
python_8 = GhPythonScript(sectionName="concreteSlab", thickness="700", nDMaterial=null)  # -> CrossSection
# ---------- python_8: Python ----------
"""Generate a Plate cross section
    Inputs:
        sectionName: Name of the section.
        thickness: Height of the cross section [mm].
        nDMaterial: Material element.
    Output:
       CrossSection: Elastic Plate Section element.
       """

import math
import Grasshopper as gh

def ElasticMembranePlateSection(sectionName, thickness, nDMaterial):
    
    sectionName = sectionName
    thickness = thickness / 1000		# Input value in mm ---> Output m
    material = nDMaterial
    sectionType = "ElasticMembranePlateSection"
    sectionProperties = sectionName + "_" + sectionType
    return [[sectionProperties, thickness, material]]

checkData = True

if sectionName is None:
    checkData = False
    msg = "input 'sectionName' failed to collect data"
    ghenv.Component.AddRuntimeMessage(gh.Kernel.GH_RuntimeMessageLevel.Warning, msg)

if thickness is None:
    checkData = False
    msg = "input 'thickness' failed to collect data"
    ghenv.Component.AddRuntimeMessage(gh.Kernel.GH_RuntimeMessageLevel.Warning, msg)

if nDMaterial is None:
    checkData = False
    msg = "input 'nDMaterial' failed to collect data"
    ghenv.Component.AddRuntimeMessage(gh.Kernel.GH_RuntimeMessageLevel.Warning, msg)

if checkData != False:
    CrossSection = ElasticMembranePlateSection(sectionName, thickness, nDMaterial)
# ---------- end python_8 ----------
python_9 = GhPythonScript(Line=[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], CrossSection=null)  # -> beamWrapper; inputs Line: Curve
# ---------- python_9: Python ----------
"""Generate a Timoshenko Beam element or a Truss element
    Inputs:
        Line: Straight line representing the structural element.
        CrossSection: Cross section of the element.
        Colour: Colour of the element.
        orientSection: Rotation angle in degrees about local X-axis.
        beamType:  0: Truss  1: Beam. Default is Beam.
    Output:
       beamWrapper: Beam with properties.
       """

import Rhino.Geometry as rg
import Rhino.RhinoMath
from System.Drawing import Color
import ghpythonlib.components as ghcomp
import Grasshopper as gh

def LineToBeam(Line, CrossSection, Colour, orientSection, beamType):

    if orientSection is None:
        orientSection = 0

    if beamType is None:
        beamType = 1



    Line = Line
    if beamType == 1 or None:
        elementType = "ElasticTimoshenkoBeam"
        if Colour is None:
            colour = Color.FromArgb(195, 195, 13)
        else:
            colour = Colour
    elif beamType == 0:
        elementType = "Truss"
        if Colour is None:
            colour = Color.FromArgb(179, 62, 143)
        else:
            colour = Colour

    CrossSection = CrossSection
    

    midPoint =  Line.PointAtNormalizedLength(0.5)
    parameter = Line.ClosestPoint(midPoint, 0.01)[1]
    perpFrame = ghcomp.PerpFrame( Line, parameter )
    perpFrame.Rotate(Rhino.RhinoMath.ToRadians(orientSection), perpFrame.ZAxis, perpFrame.Origin)
    vecGeomTransf = [ perpFrame.XAxis, perpFrame.YAxis, perpFrame.ZAxis ]

    Area = float(CrossSection[0])
    rho = float(CrossSection[6][4])
    massDens = Area * rho


    return [[Line, elementType, CrossSection, vecGeomTransf, colour, massDens, perpFrame]]

checkData = True

if Line is None:
    checkData = False
    msg = "input 'Line' failed to collect data"
    ghenv.Component.AddRuntimeMessage(gh.Kernel.GH_RuntimeMessageLevel.Warning, msg)

if CrossSection is None:
    checkData = False
    msg = "input 'CrossSection' failed to collect data"
    ghenv.Component.AddRuntimeMessage(gh.Kernel.GH_RuntimeMessageLevel.Warning, msg)


if checkData != False:
    beamWrapper = LineToBeam(Line, CrossSection, Colour, orientSection, beamType)
# ---------- end python_9 ----------
python_10 = GhPythonScript(Mesh=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, CrossSection=null)  # -> shellWrapper; inputs Mesh: Mesh
# ---------- python_10: Python ----------
"""Generate a Shell MITC4 element
    Inputs:
        Mesh: QuadMesh representing the structural element.
        CrossSection: Cross section of the mesh.
        Colour: Colour of the element.
    Output:
       shellWrapper: Shell with properties.
       """


import Rhino.Geometry as rg
import Grasshopper as gh
from System.Drawing import Color 

def MeshToShell(Mesh, Colour, CrossSection):
    
    
    elementType = []
    if Mesh.Vertices.Count == 4:
        elementType = "ShellMITC4"
        if Colour is None:
            colour = Color.FromArgb(49, 159, 255)
        else:
            colour = Colour
    else:
        elementType = "shellDKGT"
        if Colour is None:
            colour = Color.FromArgb(49, 159, 255)
        else:
            colour = Colour
    newMesh = Mesh
    
    CrossSection = CrossSection
    return[ [ newMesh , elementType, CrossSection, colour] ]

checkData = True

if Mesh is None:
    checkData = False
    msg = "input 'Mesh' failed to collect data"
    ghenv.Component.AddRuntimeMessage(gh.Kernel.GH_RuntimeMessageLevel.Warning, msg)

if CrossSection is None:
    checkData = False
    msg = "input 'CrossSection' failed to collect data"
    ghenv.Component.AddRuntimeMessage(gh.Kernel.GH_RuntimeMessageLevel.Warning, msg)


if checkData != False:
    Mesh.Unweld(0, True)
    explodedMesh = Mesh.ExplodeAtUnweldedEdges()
    shellWrapper = []
    if explodedMesh.Length > 0:
        for mesh in explodedMesh:
            shellWrapper.append(MeshToShell(mesh, Colour, CrossSection))
    elif explodedMesh.Length == 0:
            shellWrapper.append(MeshToShell(Mesh, Colour, CrossSection))
# ---------- end python_10 ----------
python_11 = GhPythonScript(nDMaterial=null)  # -> solidWrapper; inputs Brick: Mesh; same code as python_5
python_12 = GhPythonScript()  # -> supportWrapper; inputs Pos: Point3d, Tx: Int32, Ty: Int32, Tz: Int32, Rx: Int32, Ry: Int32, Rz: Int32
# ---------- python_12: Python ----------
"""Generate support for the structure.
    Inputs:
        Pos: QuadMesh representing the structural element.
        Tx: Translation in X. TRUE if it is Fixed.
        Ty: Translation in Y. TRUE if it is Fixed.
        Tz: Translation in Z. TRUE if it is Fixed.
        Rx: Rotation about the X axis. TRUE if it is Fixed.
        Ry: Rotation about the Y axis. TRUE if it is Fixed.
        Rz: Rotation about the Z axis. TRUE if it is Fixed.
    Output:
       supportWrapper: Point with constraint properties.
       """

import Grasshopper as gh


def SupportWrapper(Pos, Tx, Ty, Tz, Rx, Ry, Rz):

    Pos = Pos

    Tx = int(False) if Tx is None else Tx
    Ty = int(False) if Ty is None else Ty
    Tz = int(False) if Tz is None else Tz
    Rx = int(False) if Rx is None else Rx
    Ry = int(False) if Ry is None else Ry
    Rz = int(False) if Rz is None else Rz

    return [[Pos, Tx, Ty, Tz, Rx, Ry, Rz]]

checkData = True

if checkData != False:
    supportWrapper = SupportWrapper(Pos, Tx, Ty, Tz, Rx, Ry, Rz)
# ---------- end python_12 ----------
python_13 = GhPythonScript()  # -> beamUniformLoad; inputs Force: Vector3d, Element: Curve, Orientation: Int32; unedited script template
python_14 = GhPythonScript(Force=Point(0, 0, 0), Moment=Point(0, 0, 0))  # -> LoadWrapper; inputs Force: Vector3d, Moment: Vector3d, Pos: Point3d
# ---------- python_14: Python ----------
import Rhino.Geometry as rg

def pointLoad(Force=rg.Vector3d(0, 0, 0), Moment=rg.Vector3d(0, 0, 0), Pos = None):

    Pos = Pos
    Force = Force                  # Input value in kN ---> Output kN
    Moment = Moment 			   # Input value in kNm ---> Output kNm
    loadType = "pointLoad"

    return [[Pos, Force, Moment, loadType]]


LoadWrapper = pointLoad(Force, Moment, Pos)
# ---------- end python_14 ----------
python_15 = GhPythonScript()  # -> Mass; inputs Pos: Point3d; unedited script template
python_16 = GhPythonScript()  # -> ModelView, ModelViewExtruded, Points, Support, Load, Material, Section; inputs AlpacaModel: list
#   port AlpacaModel: Output of Assemble Model.
# ---------- python_16: Python ----------
a =1
# ---------- end python_16 ----------
python_17 = GhPythonScript()  # -> out, AlpacaModel, MassOfStructure; inputs Element: list, Support: list, Load: list, Mass: list; same code as python_5
analyze = GhPythonScript(GroundMotionFactor=1, Damping=0.02, NewmarkGamma=0.5, NewmarkBeta=0.25)  # -> AlpacaGroundmotionOutput, maxDisplacement, minDisplacement; inputs AlpacaModel: list, GroundMotionDirection: Int32, GroundMotionValues: list, GroundMotionTimeStep: list; same code as python_5
analyze_2 = GhPythonScript()  # -> AlpacaModalOutput, frequency, period; inputs AlpacaModel: list, numVibrationModes: Int32; same code as python_5
analyze_3 = GhPythonScript()  # -> AlpacaStaticOutput; inputs AlpacaModel: list; same code as python_4
int = Integer(Toggle(False))
panel = Panel(int)
data_13 = Data()

# ----
# modelView
# da fare a cluster
# OK!
file_path = FilePath("C:\GitHub\Alpaca4d\PythonScript\Post-Processing\modelView\modelView.py")
read_file = ReadFile(File=file_path, PerLineParse=False)
python_18 = GhPythonScript(
    Code=read_file,
    AlpacaModel=data_13,
    ModelExstrud=Toggle(False),
    Load=Toggle(False),
    Support=Toggle(True),
    NodalMass=Toggle(True))  # -> ModelView, LineModel, ForceDisplay, Support, LocalAxis, TagNode, TagEle, Mass
explode_tree = ExplodeTree(Data=python_18.LocalAxis)  # -> Branch0, Branch1, Branch2, Branch3
explode_tree_2 = ExplodeTree(Data=python_18.LineModel)  # -> Branch0, Branch1
geo = Geometry(python_18.ModelView)
geo_2 = Geometry(geo)
explode_tree_3 = ExplodeTree(Data=simplify(python_18.TagNode))  # -> Branch0, Branch1
explode_tree_4 = ExplodeTree(Data=simplify(python_18.TagEle))  # -> Branch0, Branch1
explode_tree_5 = ExplodeTree(Data=simplify(python_18.Mass))  # -> Branch0, Branch1
explode_tree_6 = ExplodeTree(Data=python_18.ForceDisplay)  # -> Branch0, Branch1
curve_direction = GhPythonScript(Crv=explode_tree_2.Branch0, Thickness=Slider(3, range=0..10), RGB=explode_tree_2.Branch1)  # -> out; inputs Crv: list of Curve, RGB: list of Color; same code as curve_direction
custom_preview = CustomPreview(Geometry=python_18.Support, Material=ColourSwatch(SwatchColor=RGB(164, 252, 0)))
vector_display_ex = VectorDisplayEx(Point=explode_tree_6.Branch0, Vector=explode_tree_6.Branch1, Colour=ColourSwatch(SwatchColor=RGB(176, 32, 32)), Width=2)
vector_display_ex_2 = VectorDisplayEx(Point=explode_tree.Branch0, Vector=explode_tree.Branch1, Colour=ColourSwatch(SwatchColor=RGB(252, 0, 0)), Width=2)
vector_display_ex_3 = VectorDisplayEx(Point=explode_tree.Branch0, Vector=explode_tree.Branch2, Colour=ColourSwatch(SwatchColor=RGB(0, 245, 53)), Width=2)
vector_display_ex_4 = VectorDisplayEx(Point=explode_tree.Branch0, Vector=explode_tree.Branch3, Colour=ColourSwatch(SwatchColor=RGB(0, 55, 255)), Width=2)
dot_display = DotDisplay(Point=explode_tree_5.Branch0, Colour=ColourSwatch(SwatchColor=RGB(107, 106, 102)), Size=explode_tree_5.Branch1)
tag = TextTag(Location=explode_tree_3.Branch0, Text=explode_tree_3.Branch1, Colour=ColourSwatch(SwatchColor=RGB(255, 0, 0)))
tag_2 = TextTag(Location=explode_tree_4.Branch0, Text=explode_tree_4.Branch1, Colour=ColourSwatch(SwatchColor=RGB(25, 0, 255)))

path = FilePath("C:\GitHub\Alpaca4d\PythonScript\Analyses\LinearAnalyses\initializeAnalysis.py")
# solver on folder Static Analyses 3ndf
# solver on folder Static Analyses
path_2 = FilePath("C:\GitHub\Alpaca4d\PythonScript\Analyses\openSees_StaticSolver_3ndf\initializeAnalysis_3ndf.py")
panel_2 = Panel(path)
# solver on folder Static Analyses
file = ReadFile(File=path, PerLineParse=False)
file_2 = ReadFile(File=path_2, PerLineParse=False)
analyze_4 = GhPythonScript()  # -> AlpacaModalOutput, Frequency, Period
analyze_5 = GhPythonScript(Code=file_2)  # -> Out, AlpacaStaticOutput; disabled

# ---- group: disassemble Model
python_19 = GhPythonScript()  # -> ModelView, ModelViewExtruded, Points, Support, Load, Material, Section; inputs AlpacaModel: list; disabled
#   port AlpacaModel: Output of Assemble Model.
#   port ModelView: analitic element ( beam, shell, brick ... ).
#   port ModelViewExtruded: extruded model .
#   port Points: points of model .
#   port Support: info support .
#   port Material: info Material.
#   port Section: info Section.
# ---------- python_19: Python ----------
import Rhino.Geometry as rg
import math as mt
import ghpythonlib.treehelpers as th # per data tree
import rhinoscriptsyntax as rs
import sys


folderName = r'C:\GitHub\Alpaca4d\PythonScript\function'
sys.path.append(folderName)
# importante mettere import 'import Rhino.Geometry as rg' prima di importatre DomeFunc
import DomeFunc as dg 

#---------------------------------------------------------------------------------------#

nodeWrapper = openSeesModel[0]
GeomTransf = openSeesModel[1]
openSeesBeam = openSeesModel[2]
openSeesSupport = openSeesModel[3]
openSeesNodeLoad = openSeesModel[4]
openSeesMatTag = openSeesModel[7]
openSeesShell = openSeesModel[8]
openSeesSecTag = openSeesModel[9]
openSeesSolid = openSeesModel[10]

pointWrapper = []
for item in nodeWrapper:
    point = rg.Point3d(item[1],item[2],item[3])
    pointWrapper.append( [item[0], point ] )
## Dict. for point ##
pointWrapperDict = dict( pointWrapper )
####
Points = [row[1] for row in pointWrapper ]

## Funzione cerchio ##
def AddCircleFromCenter( plane, radius):
    t = dg.linspace( 0 , 2*mt.pi, 20 )
    a = []
    for ti in t:
        x = radius*mt.cos(ti)
        y = radius*mt.sin(ti)
        a.append( plane.PointAt( x, y ) )
    #circle = rg.PolylineCurve( a )
    circle  = a 
    return circle

def AddIFromCenter(plane, Bsup, tsup, Binf, tinf, H, ta, yg):
    p1 = plane.PointAt(ta/2, -(yg - tinf) )
    p2 = plane.PointAt( Binf/2,  -(yg - tinf) )
    p3 = plane.PointAt( Binf/2,  -yg )
    p4 = plane.PointAt( -Binf/2,  -yg )
    p5 = plane.PointAt( -Binf/2, -(yg - tinf) ) 
    p6 = plane.PointAt( -ta/2,  -(yg - tinf) )
    p7 = plane.PointAt( -ta/2,  (H - yg - tsup))
    p8 = plane.PointAt( -Bsup/2,  (H - yg - tsup) )
    p9 = plane.PointAt( -Bsup/2,  (H - yg ) )
    p10 = plane.PointAt( Bsup/2,  (H - yg ) )
    p11 = plane.PointAt( Bsup/2,  (H - yg - tsup) )
    p12 = plane.PointAt( ta/2,  (H - yg - tsup) )
    wirframe  = [ p1, p2, p3, p4, p5, p6, p7, p8, p9, p10, p11, p12 ] 
    return wirframe

def ShellQuad( ele, node):
    eleTag = ele[1]
    eleNodeTag = ele[2]
    color = ele[5]
    thick = ele[4]
    index1 = eleNodeTag[0]
    index2 = eleNodeTag[1]
    index3 = eleNodeTag[2]
    index4 = eleNodeTag[3]
    
    ## CREO IL MODELLO  ##
    point1 = node.get( index1 -1 , "never")
    point2 = node.get( index2 -1 , "never")
    point3 = node.get( index3 -1 , "never")
    point4 =  node.get( index4 -1 , "never")
    
    shellModel = rg.Mesh()
    shellModel.Vertices.Add( point1 ) #0
    shellModel.Vertices.Add( point2 ) #1
    shellModel.Vertices.Add( point3 ) #2
    shellModel.Vertices.Add( point4 ) #3
    
    
    shellModel.Faces.AddFace(0, 1, 2, 3)
    colour = rs.CreateColor( color[0], color[1], color[2] )
    shellModel.VertexColors.CreateMonotoneMesh( colour )

    vt = shellModel.Vertices
    shellModel.FaceNormals.ComputeFaceNormals()
    fid,MPt = shellModel.ClosestPoint(vt[0],0.01)
    normalFace = shellModel.FaceNormals[fid]
    vectormoltiplicate = rg.Vector3d.Multiply( -normalFace, thick/2 )
    trasl = rg.Transform.Translation( vectormoltiplicate )
    moveShell = rg.Mesh.DuplicateMesh(shellModel)
    moveShell.Transform( trasl )
    extrudeShell = rg.Mesh.Offset( moveShell, thick, True, normalFace)
    
    return  [ shellModel, extrudeShell ] 

def ShellTriangle( ele, node ):
    
    eleTag = ele[1]
    eleNodeTag = ele[2]
    color = ele[5]
    index1 = eleNodeTag[0]
    index2 = eleNodeTag[1]
    index3 = eleNodeTag[2]
    
    
    ## CREO IL MODELLO DEFORMATO  ##
    point1 =  node.get( index1 -1 , "never")
    point2 =  node.get( index2 -1 , "never")
    point3 =  node.get( index3 -1 , "never")
    
    shellModel = rg.Mesh()
    shellModel.Vertices.Add( point1 ) #0
    shellModel.Vertices.Add( point2 ) #1
    shellModel.Vertices.Add( point3 ) #2
    
    shellModel.Faces.AddFace(0, 1, 2)
    colour = rs.CreateColor( color[0], color[1], color[2] )
    shellModel.VertexColors.CreateMonotoneMesh( colour )
    
    vt = shellModel.Vertices
    shellModel.FaceNormals.ComputeFaceNormals()
    fid,MPt = shellModel.ClosestPoint(vt[0],0.01)
    normalFace = shellModel.FaceNormals[fid]
    vectormoltiplicate = rg.Vector3d.Multiply( -normalFace, thick/2 ) 
    trasl = rg.Transform.Translation( vectormoltiplicate )
    moveShell = rg.Mesh.DuplicateMesh(shellModel)
    moveShell.Transform( trasl )
    extrudeShell = rg.Mesh.Offset( moveShell, thick, True, normalFace)
    
    return  [ shellModel, extrudeShell ]
    
def Solid( ele, node ):
    
    eleTag = ele[1]
    eleNodeTag = ele[2]
    color = ele[5]
    #print( eleNodeTag )
    index1 = eleNodeTag[0]
    index2 = eleNodeTag[1]
    index3 = eleNodeTag[2]
    index4 = eleNodeTag[3]
    index5 = eleNodeTag[4]
    index6 = eleNodeTag[5]
    index7 = eleNodeTag[6]
    index8 = eleNodeTag[7]
    
    ## CREO IL MODELLO DEFORMATO  ##
    point1 =  node.get( index1 -1 , "never")
    point2 =  node.get( index2 -1 , "never")
    point3 =  node.get( index3 -1 , "never")
    point4 =  node.get( index4 -1 , "never")
    point5 =  node.get( index5 -1 , "never")
    point6 =  node.get( index6 -1 , "never")
    point7 =  node.get( index7 -1 , "never")
    point8 =  node.get( index8 -1 , "never")
    #print( type(pointDef1) ) 
    shellDefModel = rg.Mesh()
    shellDefModel.Vertices.Add( point1 ) #0
    shellDefModel.Vertices.Add( point2 ) #1
    shellDefModel.Vertices.Add( point3 ) #2
    shellDefModel.Vertices.Add( point4 ) #3
    shellDefModel.Vertices.Add( point5 ) #4
    shellDefModel.Vertices.Add( point6 ) #5
    shellDefModel.Vertices.Add( point7 ) #6
    shellDefModel.Vertices.Add( point8 ) #7

    shellDefModel.Faces.AddFace(0, 1, 2, 3)
    shellDefModel.Faces.AddFace(4, 5, 6, 7)
    shellDefModel.Faces.AddFace(0, 1, 5, 4)
    shellDefModel.Faces.AddFace(1, 2, 6, 5)
    shellDefModel.Faces.AddFace(2, 3, 7, 6)
    shellDefModel.Faces.AddFace(3, 0, 4, 7)
    
    colour = rs.CreateColor( color[0], color[1], color[2] )
    shellDefModel.VertexColors.CreateMonotoneMesh( colour )
    return  shellDefModel

def TetraSolid( ele, node ):
    
    eleTag = ele[1]
    eleNodeTag = ele[2]
    color = ele[5]
    #print( eleNodeTag )
    index1 = eleNodeTag[0]
    index2 = eleNodeTag[1]
    index3 = eleNodeTag[2]
    index4 = eleNodeTag[3]
    
    ## CREO IL MODELLO DEFORMATO  ##
    point1 =  node.get( index1 -1 , "never")
    point2 =  node.get( index2 -1 , "never")
    point3 =  node.get( index3 -1 , "never")
    point4 =  node.get( index4 -1 , "never")
    
    #print( type(pointDef1) )
    
    shellDefModel = rg.Mesh()
    shellDefModel.Vertices.Add( point1 ) #0
    shellDefModel.Vertices.Add( point2 ) #1
    shellDefModel.Vertices.Add( point3 ) #2
    shellDefModel.Vertices.Add( point4 ) #3
    
    
    shellDefModel.Faces.AddFace( 0, 1, 2 )
    shellDefModel.Faces.AddFace( 0, 1, 3 )
    shellDefModel.Faces.AddFace( 1, 2, 3 )
    shellDefModel.Faces.AddFace( 0, 2, 3 )
    colour = rs.CreateColor( color[0], color[1], color[2], 0 )
    shellDefModel.VertexColors.CreateMonotoneMesh( colour )
    
    return  shellDefModel
## node e nodeDisp son dictionary ##
def Beam( ele, node):
    TagEle = ele[1]
    indexStart = ele[2][0]
    indexEnd = ele[2][1]
    color = ele[16]
    dimSection = ele[14]
    pointStart = node.get( indexStart  , "never")
    pointEnd = node.get( indexEnd  , "never")
    line = rg.LineCurve( pointStart, pointEnd )
    axis3 = pointEnd - pointStart
    axis3.Unitize()
    axis1 =  rg.Vector3d( ele[13][0], ele[13][1], ele[13][2]  )
    axis2 = rg.Vector3d.CrossProduct(axis3, axis1)
    versor = [ axis1, axis2, axis3 ] 
    
    planeStart = rg.Plane(pointStart, axis1, axis2)
    planeEnd = rg.Plane(pointEnd, axis1, axis2)
    plane = [ planeStart, planeEnd ]
    
    sectionForm = []
    sectionPolyline = []
    for sectionPlane in plane:
        
        if dimSection[0] == 'rectangular' :
            width, height = dimSection[1], dimSection[2]
            section = dg.AddRectangleFromCenter( sectionPlane, width, height )
            sectionForm.append( section )
        elif dimSection[0] == 'circular' :
            radius1  = dimSection[1]/2
            radius2  = dimSection[1]/2 - dimSection[2]
            section1 = AddCircleFromCenter( sectionPlane, radius1 )
            section2 = AddCircleFromCenter( sectionPlane, radius2 )
            sectionForm.append( [ section1, section2 ] )
        elif dimSection[0] == 'doubleT' :
            Bsup = dimSection[1]
            tsup = dimSection[2]
            Binf = dimSection[3]
            tinf = dimSection[4]
            H =  dimSection[5]
            ta =  dimSection[6]
            yg =  dimSection[7]
            section = AddIFromCenter( sectionPlane, Bsup, tsup, Binf, tinf, H, ta, yg )
            sectionForm.append( section )
        elif dimSection[0] == 'Generic' :
            radius  = dimSection[1]
            section = AddCircleFromCenter( sectionPlane, radius )
            sectionForm.append( section )
        
        
    meshExtr = meshLoft3( sectionForm,  color )
    colour = rs.CreateColor( color[0], color[1], color[2] )
    return [ line, meshExtr, colour ]

## Mesh from close section eith gradient color ##
def meshLoft3( point, color ):
    meshElement = rg.Mesh()
    if len(point[0]) < 11 : # perchè in questo caso piùsezioni
        nLength =  len(point[0]) 
        for item in range( nLength ):
            meshEle = rg.Mesh()
            pointSection1 = [row[item] for row in point ]
            for i in range(0,len(pointSection1)):
                for j in range(0, len(pointSection1[0])):
                    vertix = pointSection1[i][j]
                    meshEle.Vertices.Add( vertix ) 
                    #meshEle.VertexColors.Add( color[0],color[1],color[2] );
            k = len(pointSection1[0])
            for i in range(0,len(pointSection1)-1):
                for j in range(0, len(pointSection1[0])):
                    if j < k-1:
                        index1 = i*k + j
                        index2 = (i+1)*k + j
                        index3 = index2 + 1
                        index4 = index1 + 1
                    elif j == k-1:
                        index1 = i*k + j
                        index2 = (i+1)*k + j
                        index3 = (i+1)*k
                        index4 = i*k
                    meshEle.Faces.AddFace(index1, index2, index3, index4)
                    #rs.ObjectColor(scyl,(255,0,0))
            colour = rs.CreateColor( color[0], color[1], color[2] )
            meshEle.VertexColors.CreateMonotoneMesh( colour )
            meshElement.Append( meshEle )
    else :
        meshEle = rg.Mesh()
        pointSection1 = point
        for i in range(0,len(pointSection1)):
            for j in range(0, len(pointSection1[0])):
                vertix = pointSection1[i][j]
                print( type(vertix) )
                meshEle.Vertices.Add( vertix ) 
                #meshEle.VertexColors.Add( color[0],color[1],color[2] );
        k = len(pointSection1[0])
        for i in range(0,len(pointSection1)-1):
            for j in range(0, len(pointSection1[0])):
                if j < k-1:
                    index1 = i*k + j
                    index2 = (i+1)*k + j
                    index3 = index2 + 1
                    index4 = index1 + 1
                elif j == k-1:
                    index1 = i*k + j
                    index2 = (i+1)*k + j
                    index3 = (i+1)*k
                    index4 = i*k
                meshEle.Faces.AddFace(index1, index2, index3, index4)
                #rs.ObjectColor(scyl,(255,0,0))
        colour = rs.CreateColor( color[0], color[1], color[2] )
        meshEle.VertexColors.CreateMonotoneMesh( colour )
        meshElement = meshEle
    
    return meshElement


model = []
extrudedModel = []

for ele in openSeesBeam :
    eleTag = ele[1]
    beamModel = Beam( ele, pointWrapperDict )
    model.append([ eleTag, beamModel[0] ])
    extrudedModel.append([ eleTag, beamModel[1] ])

for ele in openSeesShell :
    nNode = len( ele[2] )
    eleTag =  ele[1] 
    if nNode == 4 :
        shellModel = ShellQuad( ele, pointWrapperDict )
        model.append([ eleTag,shellModel[0] ])
        extrudedModel.append([ eleTag,shellModel[1] ])
    elif nNode == 3:
        shellModel = ShellTriangle( ele, pointWrapperDict )
        model.append([ eleTag,shellModel[0] ])
        extrudedModel.append([ eleTag,shellModel[1] ])

for ele in openSeesSolid :
    nNode = len( ele[2] )
    eleTag =  ele[1]
    eleType = ele[0] 
    if nNode == 8:
        solidModel = Solid( ele, pointWrapperDict )
        model.append([ eleTag, solidModel ])
        extrudedModel.append([ eleTag, solidModel ])
    elif  eleType == 'FourNodeTetrahedron' :
        #print(ele)
        solidModel = TetraSolid( ele, pointWrapperDict )
        model.append([ eleTag, solidModel ])
        extrudedModel.append([ eleTag, solidModel ])

modelDict = dict( model )
modelExstrudedDict = dict( extrudedModel )
ModelView = []
ModelViewExtruded = []
for i in range(0,len(modelDict)):
    ModelView.append( modelDict.get( i  , "never" ))
    ModelViewExtruded.append( modelExstrudedDict.get( i , "never" ))

#--------------------------------------------------------------#



forceDisplay = []
for item in openSeesNodeLoad:
    loadWrapper = "{3}; Pos=[{4}]; F={1}; M={2}".format(item[0],item[1][:3],item[1][3:], item[2], pointWrapperDict.get(item[0]))
    forceDisplay.append(loadWrapper)
Load = forceDisplay



Support = []

for support in openSeesSupport :
    index = support[0]
    pos = pointWrapperDict.get(index)
    supportType = support[1:]
    supportTypeTemp = []
    for number in supportType:
        if number == 1:
            dof = True
        else:
            dof = False
        supportTypeTemp.append(dof)
    supportWrapper = "Support; Pos=[{0}]; DOF={1}".format(pos,supportTypeTemp)
    Support.append( supportWrapper )


Material = []

for item in openSeesMatTag:
    Grade= item[0].split("_")[0]
    dimensionType = item[0].split("_")[1]
    typeMat = item[0].split("_")[2]
    E = item[1][1][0]
    G = item[1][1][1]
    v = item[1][1][2]
    gamma = item[1][1][3]
    fy = item[1][1][4]
    Material.append( "grade={}; type={}; E={}; G={}; v={}; gamma={}; fy={}".format(Grade,typeMat,E,G,v,gamma,fy))


Section = []

for item in openSeesSecTag:
    name = item[0].split("_")[0]
    typeSec = item[0].split("_")[1]
    Section.append("name={}; type={}".format(name, typeSec))
# ---------- end python_19 ----------

# ----
# OK!
file_path_2 = FilePath("C:\GitHub\Alpaca4d\PythonScript\Post-Processing\disassembleModel\disassembleModel.py")
read_file_2 = ReadFile(File=file_path_2, PerLineParse=False)
panel_3 = Panel(python_19.ModelViewExtruded)

analyze_6 = GhPythonScript(Code=file)  # -> Out, AlpacaStaticOutput, MaxDisplacement
panel_4 = Panel(python_18.ForceDisplay)

# ----
# Modal Animate
number_slider = Slider(7, range=0..10)
path_3 = FilePath("C:\GitHub\Alpaca4d\PythonScript\Post-Processing\animateModal\animateModal.py")
list = ValueList({"tx": 0, "ty": 1, "tz": 2}, selected="ty")
file_3 = ReadFile(File=path_3, PerLineParse=False)

# ---- group: MODAL ANALYSIS
ghpython_script = GhPythonScript(
    Code=file_3,
    NumberMode=Slider(2, range=0..10),
    Speed=Slider(1, range=1..50),
    Animate=Toggle(False),
    Reset=Button(),
    Scale=number_slider,
    Direction=list,
    ModelExstrud=Toggle(False))  # -> Out, simplify(ModelCurve), simplify(ModelShell), simplify(ModelSolid)

# ----
list_2 = ValueList({"tx": 0, "ty": 1, "tz": 2, "txyz": 3}, selected="tx")
merge = Merge(Data1=analyze_6.AlpacaStaticOutput, Data2=analyze_5.AlpacaStaticOutput)  # -> flatten(Result)
cluster = Cluster(
    tree_2=simplify(ghpython_script.ModelCurve),
    tree=simplify(ghpython_script.ModelShell),
    tree_3=simplify(ghpython_script.ModelSolid),
    gate=list_2)
merge_2 = Merge(Data1=analyze_6.AlpacaStaticOutput, Data2=analyze_5.AlpacaStaticOutput)  # -> flatten(Result)

# ---- group: Reaction Forces
# Reactions
number_slider_2 = Slider(10, range=0..100)
file_path_3 = FilePath("C:\GitHub\Alpaca4d\PythonScript\Post-Processing\reaction\reaction.py")
read_file_3 = ReadFile(File=file_path_3, PerLineParse=False)
python_20 = GhPythonScript(
    Code=read_file_3,
    AlpacaStaticOutput=analyze_6.AlpacaStaticOutput,
    ReactionForcesView=Toggle(True),
    ReactionMomentsView=Toggle(True),
    Scale=number_slider_2)  # -> Out, TagPoints, ReactionForce, ReactionMoment, View
reactionforce = ReactionForce(python_20.ReactionForce)
tagpoints = TagPoints(python_20.TagPoints)
reactionmoment = ReactionMoment(python_20.ReactionMoment)
explode_tree_7 = ExplodeTree(Data=python_20.View)  # -> Branch0, Branch1, Branch2, Branch3, Branch4, Branch5, Branch6
vector_display_ex_5 = VectorDisplayEx(
    Point=explode_tree_7.Branch0,
    Vector=[explode_tree_7.Branch3, explode_tree_7.Branch2, explode_tree_7.Branch1],
    Colour=ColourSwatch(SwatchColor=RGB(252, 0, 0)),
    Width=2)
vector_display_ex_6 = VectorDisplayEx(
    Point=explode_tree_7.Branch0,
    Vector=[explode_tree_7.Branch6, explode_tree_7.Branch5, explode_tree_7.Branch4],
    Colour=ColourSwatch(SwatchColor=RGB(0, 55, 255)),
    Width=2)

# ---- group: Cds Visualisation
# CDS view
number_slider_3 = Slider(0.675, range=0.001..10)  # disabled
file_path_4 = FilePath("C:\GitHub\Alpaca4d\PythonScript\Post-Processing\cdsView\cdsView.py")  # disabled
read_file_4 = ReadFile(File=file_path_4, PerLineParse=False)  # disabled
list_3 = ValueList({"N": 0, "V1": 1, "V2": 2, "M2": 3, "M1": 4, "Mt": 5}, selected="N")  # disabled
python_21 = GhPythonScript(Code=read_file_4, AlpacaStaticOutput=analyze_6.AlpacaStaticOutput, Cds=list_3)  # disabled

# ---- group: Beam Forces
# CDS valor
number_slider_4 = Slider(10, range=0..10)  # disabled
file_path_5 = FilePath("C:\GitHub\Alpaca4d\PythonScript\Post-Processing\beamForces\beamForces.py")  # disabled
# beam Component
read_file_5 = ReadFile(File=file_path_5, PerLineParse=False)  # disabled
python_22 = GhPythonScript(Code=read_file_5, AlpacaStaticOutput=analyze_6.AlpacaStaticOutput)  # -> Out, TagElement, N, V1, V2, Mt, M1, M2; disabled

# ---- group: shell Force Visualisation
# Forces view
# da riguardare per i valori
file_path_6 = FilePath("C:\GitHub\Alpaca4d\PythonScript\Post-Processing\shellForceView\shellForceView.py")  # disabled
read_file_6 = ReadFile(File=file_path_6, PerLineParse=False)  # disabled
list_4 = ValueList({"8Color": 0, "20Color": 1}, selected="8Color")
list_5 = ValueList({"Fx": 0, "Fy": 1, "Fz": 2, "Mx": 3, "My": 4, "Mz": 5}, selected="Fx")  # disabled
python_23 = GhPythonScript(Code=read_file_6, AlpacaStaticOutput=analyze_6.AlpacaStaticOutput, ViewForce=list_5)  # -> ModelForce, ForceValue; disabled
bounds = Bounds(Numbers=flatten(python_23.ForceValue))  # disabled
file_path_7 = FilePath("C:\GitHub\Alpaca4d\PythonScript\function\AlpacaColorMesh.py")  # disabled
deconstruct_domain = DeconstructDomain(Domain=bounds)  # -> Start, End; disabled
read_file_7 = ReadFile(File=file_path_7, PerLineParse=False)  # disabled
ghpython_script_2 = GhPythonScript(Code=read_file_7, Min=deconstruct_domain.Start, Max=deconstruct_domain.End, Value=python_23.ForceValue, NColor=list_4)  # -> Out, Color, Tag, Domain, ColorValue; disabled
panel_5 = Panel("{0}")  # disabled
panel_6 = Panel("{0}")  # disabled
panel_7 = Panel("{0}")  # disabled
split_tree = SplitTree(Data=simplify(ghpython_script_2.Color), Masks=simplify(panel_5))  # -> Positive, Negative; disabled
split_tree_2 = SplitTree(Data=simplify(ghpython_script_2.Tag), Masks=simplify(panel_6))  # -> Positive, Negative; disabled
split_tree_3 = SplitTree(Data=simplify(ghpython_script_2.Domain), Masks=simplify(panel_7))  # -> Positive, Negative; disabled
mesh_colours = MeshColours(Mesh=graft(python_23.ModelForce), Colours=ghpython_script_2.ColorValue)  # disabled
positive = Positive(split_tree_2.Positive)  # disabled
mesh = Mesh(mesh_colours)  # disabled
positive_2 = Positive(split_tree.Positive)  # disabled

# ---- group: shell Forces
# Forces valor
file_path_8 = FilePath("C:\GitHub\Alpaca4d\PythonScript\Post-Processing\shellForces\shellForces.py")
read_file_8 = ReadFile(File=file_path_8, PerLineParse=False)
python_24 = GhPythonScript(Code=read_file_8, AlpacaStaticOutput=analyze_6.AlpacaStaticOutput)  # -> Out, TagElement, Fx, Fy, Fz, Mx, My, Mz

# ----
# Brick component
list_6 = ValueList({"8Color": 0, "20Color": 1}, selected="20Color")  # disabled

# ---- group: nD Stress Visualisation
# Stress view & valor
file_path_9 = FilePath("C:\GitHub\Alpaca4d\PythonScript\Post-Processing\brickStress\brickStress.py")  # disabled
read_file_9 = ReadFile(File=file_path_9, PerLineParse=False)  # disabled
list_7 = ValueList({"sigmaX": 0, "sigmaY": 1, "sigmaZ": 2, "tauXY": 3, "tauXZ": 4, "tauYZ": 5}, selected="tauYZ")  # disabled
python_25 = GhPythonScript(Code=read_file_9, AlpacaStaticOutput=analyze_5.AlpacaStaticOutput, StressView=list_7)  # -> Brick, StressValue; disabled
bounds_2 = Bounds(Numbers=flatten(python_25.StressValue))  # disabled
deconstruct_domain_2 = DeconstructDomain(Domain=bounds_2)  # -> Start, End; disabled
ghpython_script_3 = GhPythonScript(min=deconstruct_domain_2.Start, max=deconstruct_domain_2.End, value=python_25.StressValue, nColor=list_6)  # -> out, color, tag, domain, colorValue; inputs value: list, nColor: Int32; disabled
# ---------- ghpython_script_3: Python ----------
import Rhino.Geometry as rg
import ghpythonlib.components as ghcomp
import math as mt
import ghpythonlib.treehelpers as th # per data tree
import Grasshopper
#import System as sy #DV
import sys
import rhinoscriptsyntax as rs

'''
ghFilePath = ghenv.LocalScope.ghdoc.Path
ghFileName = ghenv.LocalScope.ghdoc.Name
folderNameLength = len(ghFilePath)-len(ghFileName)-2 #have to remove '.gh'
ghFolderPath = ghFilePath[0:folderNameLength]

outputPath = ghFolderPath + 'assembleData'
wrapperFile = ghFolderPath + 'assembleData\\openSeesModel.txt'

userObjectFolder = Grasshopper.Folders.DefaultUserObjectFolder
fileName = userObjectFolder + 'Alpaca'
'''
fileName = r'C:\GitHub\Alpaca4d\PythonScript\function'
sys.path.append(fileName)
# importante mettere import 'import Rhino.Geometry as rg' prima di importatre DomeFunc
import DomeFunc as dg 
def gradientJet(value, valueMax, valueMin, nColor):
    if nColor == 0:
        listcolo = [rs.CreateColor( 0, 0, 255 ),
                    rs.CreateColor( 0, 128, 255 ),
                    rs.CreateColor( 0, 255, 255 ),
                    rs.CreateColor( 0, 255, 128 ),
                    rs.CreateColor( 128, 255, 0 ),
                    rs.CreateColor( 255, 255, 0 ),
                    rs.CreateColor( 255, 128, 0 ),
                    rs.CreateColor( 204, 0, 0 )]
    elif nColor == 1:
        listcolo = [ rs.CreateColor( 0, 0, 102 ),
                    rs.CreateColor( 0, 0, 255 ),
                    rs.CreateColor( 0, 64, 255 ),
                    rs.CreateColor( 0, 128, 255 ),
                    rs.CreateColor( 0, 191, 255 ),
                    rs.CreateColor( 0, 255, 255 ),
                    rs.CreateColor( 0, 255, 191 ),
                    rs.CreateColor( 0, 255, 128 ),
                    rs.CreateColor( 0, 255, 64 ),
                    rs.CreateColor( 0, 255, 0 ),
                    rs.CreateColor( 64, 255, 0 ),
                    rs.CreateColor( 128, 255, 0 ),
                    rs.CreateColor( 191, 255, 0 ),
                    rs.CreateColor( 255, 255, 0 ),
                    rs.CreateColor( 255, 191, 0 ),
                    rs.CreateColor( 255, 128, 0 ),
                    rs.CreateColor( 255, 64, 0 ),
                    rs.CreateColor( 255, 0, 0 ),
                    rs.CreateColor( 230, 0, 0 ),
                    rs.CreateColor( 204, 0, 0 )]
    #domain = linspace( valueMin,  valueMax, len( listcolo ) )
    n = len( listcolo )
    domain = dg.linspace( valueMin, valueMax, n)
    
    for i in range(1,n):
        if  domain[i-1] <= value <= domain[i]:
            return listcolo[ i ]
        elif  valueMax <= value <= valueMax + 0.00001 :
            return listcolo[ -1 ]
        elif  valueMin - 0.00000000001 <= value <= valueMin  :
            return listcolo[ 0 ]

def gradientJet2(valueMax, valueMin, nColor ):

    if nColor == 0:
        listcolo = [rs.CreateColor( 0, 0, 255 ),
                    rs.CreateColor( 0, 128, 255 ),
                    rs.CreateColor( 0, 255, 255 ),
                    rs.CreateColor( 0, 255, 128 ),
                    rs.CreateColor( 128, 255, 0 ),
                    rs.CreateColor( 255, 255, 0 ),
                    rs.CreateColor( 255, 128, 0 ),
                    rs.CreateColor( 204, 0, 0 )]
    elif nColor == 1:
        listcolo = [ rs.CreateColor( 0, 0, 102 ),
                    rs.CreateColor( 0, 0, 255 ),
                    rs.CreateColor( 0, 64, 255 ),
                    rs.CreateColor( 0, 128, 255 ),
                    rs.CreateColor( 0, 191, 255 ),
                    rs.CreateColor( 0, 255, 255 ),
                    rs.CreateColor( 0, 255, 191 ),
                    rs.CreateColor( 0, 255, 128 ),
                    rs.CreateColor( 0, 255, 64 ),
                    rs.CreateColor( 0, 255, 0 ),
                    rs.CreateColor( 64, 255, 0 ),
                    rs.CreateColor( 128, 255, 0 ),
                    rs.CreateColor( 191, 255, 0 ),
                    rs.CreateColor( 255, 255, 0 ),
                    rs.CreateColor( 255, 191, 0 ),
                    rs.CreateColor( 255, 128, 0 ),
                    rs.CreateColor( 255, 64, 0 ),
                    rs.CreateColor( 255, 0, 0 ),
                    rs.CreateColor( 230, 0, 0 ),
                    rs.CreateColor( 204, 0, 0 )]

    #domain = linspace( valueMin,  valueMax, len( listcolo ) )
    n = len( listcolo )
    diff = (float(valueMax) - valueMin)/( n - 1 )
    domain = [diff * i + valueMin  for i in range(n)]
    return [ listcolo, domain ]

colorList = gradientJet2( max, min, nColor )
color = colorList[0]  #.reverse()
color.reverse()
tag = []
tag.append( str(round(colorList[1][0],2) ) )
for i in range(1,len(colorList[1])):
    tag.append( str(round(colorList[1][i-1],2)) + '< valor < ' + str(round(colorList[1][i],2)) )
domain = colorList[1]
tag.reverse()

colorValue = []
for i in value:
    colorValue.append(gradientJet(i, max, min, nColor))
    print(len(value))
# ---------- end ghpython_script_3 ----------
panel_8 = Panel("{0}")  # disabled
panel_9 = Panel("{0}")  # disabled
panel_10 = Panel("{0}")  # disabled
split_tree_4 = SplitTree(Data=simplify(ghpython_script_3.color), Masks=simplify(panel_8))  # -> Positive, Negative; disabled
split_tree_5 = SplitTree(Data=simplify(ghpython_script_3.tag), Masks=simplify(panel_9))  # -> Positive, Negative; disabled
mesh_colours_2 = MeshColours(Mesh=graft(python_25.Brick), Colours=ghpython_script_3.colorValue)  # disabled
split_tree_6 = SplitTree(Data=simplify(ghpython_script_3.domain), Masks=simplify(panel_10))  # -> Positive, Negative; disabled

# ----
# deformedModelView
# OK!
number_slider_5 = Slider(1908, range=0..10000)
file_path_10 = FilePath("C:\GitHub\Alpaca4d\PythonScript\Post-Processing\defModelView\defModelView.py")
read_file_10 = ReadFile(File=file_path_10, PerLineParse=False)
python_26 = GhPythonScript(Code=read_file_10, AlpacaStaticOutput=merge, Scale=number_slider_5, ModelExstrud=Toggle(False))  # -> Out, simplify(ModelCurve), simplify(ModelShell), simplify(ModelSolid)
list_8 = ValueList({"tx": 0, "ty": 1, "tz": 2, "txyz": 3}, selected="ty")

# ----
# Disp Numerical Ouput
# OK!
number_slider_6 = Slider(10, range=0..10)
file_path_11 = FilePath("C:\GitHub\Alpaca4d\PythonScript\Post-Processing\beamDisp\beamDisp.py")
file_path_12 = FilePath("C:\GitHub\Alpaca4d\PythonScript\Post-Processing\nodalDisp\nodalDisp.py")
file_path_13 = FilePath("C:\GitHub\Alpaca4d\PythonScript\Post-Processing\brickDisp\brickDisp.py")
file_path_14 = FilePath("C:\GitHub\Alpaca4d\PythonScript\Post-Processing\shellDisp\shellDisp.py")
read_file_11 = ReadFile(File=file_path_11, PerLineParse=False)
read_file_12 = ReadFile(File=file_path_14, PerLineParse=False)
read_file_13 = ReadFile(File=file_path_12, PerLineParse=False)
read_file_14 = ReadFile(File=file_path_13, PerLineParse=False)

# ---- group: brick Displacement
python_27 = GhPythonScript(Code=read_file_14, AlpacaStaticOutput=analyze_5.AlpacaStaticOutput)  # -> Out, TagElement, Trans

# ---- group: Shell Displacement
python_28 = GhPythonScript(Code=read_file_12, AlpacaStaticOutput=analyze_6.AlpacaStaticOutput)  # -> Out, TagElement, Trans, Rot

# ---- group: Beam Displacement
python_29 = GhPythonScript(Code=read_file_11, AlpacaStaticOutput=analyze_6.AlpacaStaticOutput, NumberResults=number_slider_6)  # -> Out, TagElement, LocalTrans, LocalRot, GlobalTrans, GlobalRot

# ---- group: NodeDisp
python_30 = GhPythonScript(Code=read_file_13, AlpacaStaticOutput=merge_2)  # -> Out, Points, Trans, Rot

# ----
# Force component
panel_11 = Panel(python_24.Fx)

# ----
# displacement Component
cluster_2 = Cluster(
    tree_2=simplify(python_26.ModelCurve),
    tree=simplify(python_26.ModelShell),
    tree_3=simplify(python_26.ModelSolid),
    gate=list_8)

# ---- group: Shell Stress Visualisation
# Stress view & valor
file_path_15 = FilePath("C:\GitHub\Alpaca4d\PythonScript\Post-Processing\shellStressView\shellStressView.py")
read_file_15 = ReadFile(File=file_path_15, PerLineParse=False)
list_9 = ValueList({"pxx": 0, "pyy": 1, "pxy": 2, "txz": 3, "tyz": 4, "mxx": 5, "myy": 6, "mxy": 7}, selected="pxx")
python_31 = GhPythonScript(Code=read_file_15, AlpacaStaticOutput=analyze_6.AlpacaStaticOutput, StressView=list_9)  # -> Shell, StressValue
bounds_3 = Bounds(Numbers=flatten(python_31.StressValue))
deconstruct_domain_3 = DeconstructDomain(Domain=bounds_3)  # -> Start, End

# ----
# shell Component
list_10 = ValueList({"8Color": 0, "20Color": 1}, selected="8Color")
stressvalue = StressValue(python_31.StressValue)
file_path_16 = FilePath("C:\GitHub\Alpaca4d\PythonScript\function\AlpacaColorMesh.py")
read_file_16 = ReadFile(File=file_path_16, PerLineParse=False)

mass_addition = MassAddition(Input=python_31.StressValue)  # -> Result, PartialResults
list_length = ListLength(List=mass_addition.PartialResults)
division = Division(A=mass_addition.Result, B=list_length)
gradient = Gradient(
    LowerLimit=deconstruct_domain_3.Start,
    UpperLimit=deconstruct_domain_3.End,
    Parameter=python_31.StressValue,
    stops=[0: RGB(234, 38, 0), 0.25: RGB(234, 126, 0), 0.5: RGB(254, 244, 84), 0.75: RGB(173, 203, 249), 1: RGB(75, 107, 169)])

# ---- group: Shell Stress Visualisation (continued)
ghpython_script_4 = GhPythonScript(
    Code=read_file_16,
    Min=deconstruct_domain_3.Start,
    Max=deconstruct_domain_3.End,
    Value=python_31.StressValue,
    NColor=list_10)  # -> Out, Color, Tag, Domain, ColorValue
mesh_colours_3 = MeshColours(Mesh=simplify(graft(python_31.Shell)), Colours=simplify(gradient))
split_tree_7 = SplitTree(Data=simplify(ghpython_script_4.Color), Masks=simplify("{0}"))  # -> Positive, Negative
split_tree_8 = SplitTree(Data=simplify(ghpython_script_4.Tag), Masks=simplify("{0}"))  # -> Positive, Negative
split_tree_9 = SplitTree(Data=simplify(ghpython_script_4.Domain), Masks=simplify("{0}"))  # -> Positive, Negative
positive_3 = Positive(split_tree_8.Positive)
positive_4 = Positive(split_tree_7.Positive)
mesh_2 = Mesh(mesh_colours_3)

# ==== cluster Cluster
tree = ClusterInput()
tree_2 = ClusterInput()
gate = ClusterInput()
tree_3 = ClusterInput()
tree_statistics = TreeStatistics(Tree=tree_2)  # -> Paths, Length, Count
tree_statistics_2 = TreeStatistics(Tree=tree)  # -> Paths, Length, Count
cull_index = CullIndex(List=tree_statistics.Paths, Indices="0", Wrap=True)
tree_statistics_3 = TreeStatistics(Tree=tree_3)  # -> Paths, Length, Count
construct_path = ConstructPath(Indices="0")
cull_index_2 = CullIndex(List=tree_statistics_2.Paths, Indices="0", Wrap=True)
construct_path_2 = ConstructPath(Indices="0")
cull_index_3 = CullIndex(List=tree_statistics_3.Paths, Indices="0", Wrap=True)
tree_branch = TreeBranch(Tree=tree_2, Path=construct_path, MaintainPaths=True)
tree_branch_2 = TreeBranch(Tree=tree_2, Path=cull_index, MaintainPaths=True)
construct_path_3 = ConstructPath(Indices="0")
tree_branch_3 = TreeBranch(Tree=tree, Path=construct_path_2, MaintainPaths=True)
tree_branch_4 = TreeBranch(Tree=tree, Path=cull_index_2, MaintainPaths=True)
list_length = ListLength(List=tree_branch_2)
tree_branch_5 = TreeBranch(Tree=tree_3, Path=construct_path_3, MaintainPaths=True)
tree_branch_6 = TreeBranch(Tree=tree_3, Path=cull_index_3, MaintainPaths=True)
deconstruct_vector = DeconstructVector(Vector=tree_branch_4)  # -> XComponent, YComponent, ZComponent
divide_curve = DivideCurve(Curve=tree_branch, Count=flatten(list_length), Kinks=False)  # -> Points, Tangents, simplify(Parameters)
deconstruct_vector_2 = DeconstructVector(Vector=tree_branch_6)  # -> XComponent, YComponent, ZComponent
stream_filter = StreamFilter(
    Gate=gate,
    Stream0=deconstruct_vector.XComponent,
    Stream1=deconstruct_vector.YComponent,
    Stream2=deconstruct_vector.ZComponent,
    Stream3=tree_branch_4)
stream_filter_2 = StreamFilter(
    Gate=gate,
    Stream0=deconstruct_vector_2.XComponent,
    Stream1=deconstruct_vector_2.YComponent,
    Stream2=deconstruct_vector_2.ZComponent,
    Stream3=tree_branch_6)
deconstruct_vector_3 = DeconstructVector(Vector=tree_branch_2)  # -> XComponent, YComponent, ZComponent
merge = Merge(Data1=tree_branch_2, Data2=tree_branch_4, Data3=tree_branch_5)  # -> flatten(Result)
stream_filter_3 = StreamFilter(
    Gate=gate,
    Stream0=deconstruct_vector_3.XComponent,
    Stream1=deconstruct_vector_3.YComponent,
    Stream2=deconstruct_vector_3.ZComponent,
    Stream3=tree_branch_2)
deconstruct_vector_4 = DeconstructVector(Vector=merge)  # -> XComponent, YComponent, ZComponent
stream_filter_4 = StreamFilter(
    Gate=gate,
    Stream0=deconstruct_vector_4.XComponent,
    Stream1=deconstruct_vector_4.YComponent,
    Stream2=deconstruct_vector_4.ZComponent,
    Stream3=merge)
bounds = Bounds(Numbers=flatten(stream_filter_4))
deconstruct_domain = DeconstructDomain(Domain=bounds)  # -> Start, End
shatter = Shatter(Curve=graft(tree_branch), Parameters=divide_curve.Parameters)  # -> simplify(graft(Segments))
gradient = Gradient(
    LowerLimit=deconstruct_domain.Start,
    UpperLimit=deconstruct_domain.End,
    Parameter=stream_filter_3,
    stops=[0: RGB(234, 38, 0), 0.25: RGB(234, 126, 0), 0.5: RGB(254, 244, 84), 0.75: RGB(173, 203, 249), 1: RGB(75, 107, 169)])
gradient_2 = Gradient(
    LowerLimit=deconstruct_domain.Start,
    UpperLimit=deconstruct_domain.End,
    Parameter=stream_filter,
    stops=[0: RGB(234, 38, 0), 0.25: RGB(234, 126, 0), 0.5: RGB(254, 244, 84), 0.75: RGB(173, 203, 249), 1: RGB(75, 107, 169)])
number_slider = Slider(3, range=0..10)
gradient_3 = Gradient(
    LowerLimit=deconstruct_domain.Start,
    UpperLimit=deconstruct_domain.End,
    Parameter=stream_filter_2,
    stops=[0: RGB(234, 38, 0), 0.25: RGB(234, 126, 0), 0.5: RGB(254, 244, 84), 0.75: RGB(173, 203, 249), 1: RGB(75, 107, 169)])
curve = Curve(flatten(shatter))
curve_direction = GhPythonScript(Crv=curve, Thickness=number_slider, RGB=flatten(gradient))  # -> out; inputs Crv: list of Curve, RGB: list of Color
# ---------- curve_direction: Python ----------
from ghpythonlib.componentbase import executingcomponent as component
import Grasshopper, GhPython
import System
import Rhino as rh
import rhinoscriptsyntax as rs
import Rhino.Geometry as rg


class CurveColor(component):

    def RunScript(self,Crv,Thickness,RGB):
        self.C = Crv
        self.RGB = RGB
        self.t = Thickness
        if not self.C: return
            
    def DrawViewportWires(self,arg):
        if not  self.C: return
        for curve, color in zip( self.C, self.RGB ):
            arg.Display.DrawCurve(curve, color,self.t)
# ---------- end curve_direction ----------
custom_preview_lineweights = CustomPreviewLineweights(Geometry=curve, Shader=flatten(gradient), Thickness=number_slider, Absolute=False)
mesh_colours = MeshColours(Mesh=graft(tree_branch_3), Colours=gradient_2)
mesh_colours_2 = MeshColours(Mesh=graft(tree_branch_5), Colours=gradient_3)
