# Grasshopper definition AlpacaLogo.gh (Grasshopper 1.0.7)
# plug-ins: Human

geo = Geometry([<brep referenced from the Rhino model> x45])
# Format Engineers CAD Information Issue Disclaimer
# 
# Project: PROJECT NAME
# 
# You should use this model for reference purposes only to assist in co-ordinating your work and is supplementary to formally issued drawings. Once the data is introduced into your own CAD or other system Format Engineers Ltd. can take no responsibility for its accuracy.
# 
# The last set of formally issued paper drawings are the contractual documents which represent the current stage of design development. If you have any queries, please contact the project CAD co-ordinator or the CAD Development Team.
# 
# Changes:
# 
# YYYY-MM-DD: Summary of changes
# 
# Usage notes:
# 
# This definition includes a basic implementation of Merbarki's Farthest Point Seeding algorithm (2005), adapted for tracing lines of principal curvature on NURBS surfaces. Requires modified Triangle.NET, if this isn't attached then... good luck! There are currently two main limitations: (a) this implementation measures density in parameter space, and (b) it doesn't include the dynamic refinement of density that Mebarki suggests.
geo_2 = Geometry([<brep referenced from the Rhino model> x117])
debrep = DeconstructBrep(Brep=geo_2)  # -> Faces, Edges, Vertices
debrep_2 = DeconstructBrep(Brep=geo)  # -> Faces, Edges, Vertices

# ----
# 64 x 64 icon
geo_3 = Geometry([<brep referenced from the Rhino model> x45])
geo_4 = Geometry([<brep referenced from the Rhino model> x117])
join = BrepJoin(Breps=flatten(geo_4))  # -> Breps, Closed
join_2 = BrepJoin(Breps=flatten(geo_3))  # -> Breps, Closed
edges = BrepEdges(Brep=join.Breps)  # -> Naked, Interior, NonManifold
edges_2 = BrepEdges(Brep=join_2.Breps)  # -> Naked, Interior, NonManifold
crv = Curve([edges.Naked, edges.Interior])
crv_2 = Curve(edges_2.Naked)
previewlw = CustomPreviewLineweights(Geometry=crv, Shader=ColourSwatch(SwatchColor=RGB(255, 255, 255)), Thickness=Slider(1, range=1..5), Absolute=False)
previewlw_2 = CustomPreviewLineweights(Geometry=crv_2, Shader=ColourSwatch(SwatchColor=RGB(255, 255, 255)), Thickness=Slider(1, range=1..5), Absolute=False)

number_slider = Slider(1, range=0..1)
crv_3 = Curve(debrep.Edges)
crv_4 = Curve(debrep_2.Edges)
previewlw_3 = CustomPreviewLineweights(Geometry=crv_3, Shader=ColourSwatch(SwatchColor=RGB(255, 255, 255)), Thickness=Slider(2, range=1..5), Absolute=False)
previewlw_4 = CustomPreviewLineweights(Geometry=crv_4, Shader=ColourSwatch(SwatchColor=RGB(255, 255, 255)), Thickness=Slider(1, range=1..5), Absolute=False)
