# Grasshopper definition recorderExample.gh (Grasshopper 1.0.7)
# plug-ins: Human, Kangaroo Components, Weaverbird, GH_CPython, Kangaroo2 Components

construct_point = ConstructPoint(XCoordinate=0, YCoordinate=0, ZCoordinate=0)
interassa_x = Slider(5, range=4..8)
unit_x = UnitX(Factor=Slider(20, range=0..100))
move = Move(Geometry=construct_point, Motion=unit_x)  # -> Geometry, Transform
line = Line(StartPoint=construct_point, EndPoint=move.Geometry)
length = Length(Curve=line)
division = Division(A=length, B=interassa_x)
divide_curve = DivideCurve(Curve=line, Count=division, Kinks=False)  # -> Points, Tangents, Parameters
number_slider = Slider(20, range=0..100)
interasse_y = Slider(5, range=4..8)
polyline = PolyLine(Vertices=divide_curve.Points, Closed=False)
construct_domain = ConstructDomain(DomainStart=0, DomainEnd=number_slider)
division_2 = Division(A=number_slider, B=interasse_y)
range = Range(Domain=construct_domain, Steps=division_2)
unit_y = UnitY(Factor=range)
move_2 = Move(Geometry=polyline, Motion=unit_y)  # -> Geometry, Transform
explode = Explode(Curve=move_2.Geometry, Recursive=True)  # -> Segments, simplify(Vertices)

# ----
# CrossSection
panel = Panel("1")
python = GhPythonScript(
    matId=panel,
    A="10000000",
    E="210000.0",
    G="65625.0",
    J="18446180555555.55",
    Iz="1041666.6666666665",
    Iy="4166666.666666666")  # -> out, flatten(crossSection); inputs matId: Int32
# ---------- python: Python ----------
crossSection = [ [matId , A, E, G, J, Iy, Iz] ]
# ---------- end python ----------

flip_matrix = FlipMatrix(Data=explode.Vertices)  # -> simplify(Data)
polyline_2 = PolyLine(Vertices=flip_matrix, Closed=False)
explode_2 = Explode(Curve=polyline_2, Recursive=True)  # -> Segments, Vertices
number_slider_2 = Slider(1000, range=-1000..1000)
orditura_x = Curve(simplify(explode.Segments))
orditura_y = Curve(simplify(explode_2.Segments))
interasse_piano = Slider(4, range=3..5)
n_di_piani = Slider(15, range=3..30)
multiplication = Multiplication(A=interasse_piano, B=n_di_piani)
multiplication_2 = Multiplication(A=Slider(6960, range=0..10000), B=number_slider_2)
weaverbird_s_mesh_from_lines_weave_back = WeaverbirdsMeshFromLinesWeaveBack(Lines=flatten([orditura_x, orditura_y]), MaximumValence=4)
panel_2 = Panel(multiplication)
vec = VectorXYZ(XComponent=multiplication_2, YComponent=0, ZComponent=number_slider_2)  # -> Vector, Length
series = Series(Start=0, Step=interasse_piano, Count=n_di_piani)
unit_z = UnitZ(Factor=series)
move_3 = Move(Geometry=weaverbird_s_mesh_from_lines_weave_back, Motion=unit_z)  # -> Geometry, Transform
deconstruct_mesh = DeconstructMesh(Mesh=move_3.Geometry)  # -> Vertices, Faces, Colours, Normals
warpweft = WarpWeft(Mesh=move_3.Geometry)  # -> Warp, Weft, NakedA, NakedB
flip_matrix_2 = FlipMatrix(Data=deconstruct_mesh.Vertices)
number_slider_3 = Slider(1000, range=-1000..1000)
polyline_3 = PolyLine(Vertices=flip_matrix_2, Closed=False)  # -> simplify(Polyline)
direzione_y = Curve(simplify(warpweft.Warp))
direzione_x = Curve(simplify(warpweft.Weft))
vec_2 = VectorXYZ(XComponent=number_slider_3, YComponent=number_slider_3, ZComponent="0")  # -> Vector, Length
vec_3 = VectorXYZ(XComponent="1.0e-10", YComponent="1.0e-10", ZComponent="1.0e-10")  # -> Vector, Length
colonne = Curve(polyline_3)
explode_3 = Explode(Curve=colonne, Recursive=True)  # -> simplify(Segments), Vertices
construct_path = ConstructPath(Indices=Slider(0, range=0..100))
construct_path_2 = ConstructPath(Indices=Slider(0, range=0..100))
split_tree = SplitTree(Data=direzione_x, Masks=flatten(construct_path))  # -> Positive, Negative
split_tree_2 = SplitTree(Data=direzione_y, Masks=flatten(construct_path_2))  # -> Positive, Negative
number_slider_4 = Slider(20212, range=0..100000)
colonne_2 = Curve(explode_3.Segments)
point = Point(flatten(deconstruct_mesh.Vertices))
direzione_y_2 = Curve(split_tree.Negative)
direzione_x_2 = Curve(split_tree_2.Negative)
merge = Merge(Data1=direzione_x_2, Data2=direzione_y_2)  # -> flatten(Result)
list_length = ListLength(List=merge)
entwine = Entwine(Branch00=merge, Branch01=colonne_2, FlattenInputs=True)  # -> flatten(Result)
end = EndPoints(Curve=entwine)  # -> flatten(Start), End
pt = Point(end.Start)
duppt = RemoveDuplicatePts(Points=pt, Tolerance=0.01)
pdecon = Deconstruct(Point=duppt)  # -> XComponent, YComponent, ZComponent
bnd = Bounds(Numbers=flatten(pdecon.ZComponent))
dedomain = DeconstructDomain(Domain=bnd)  # -> Start, End
addition = Addition(A=dedomain.Start, B=Slider(0.1, range=0.1..32))
smaller = SmallerThan(FirstNumber=pdecon.ZComponent, SecondNumber=addition)  # -> SmallerThan, OrEqualTo
larger = LargerThan(FirstNumber=pdecon.ZComponent, SecondNumber=panel_2)  # -> LargerThan, OrEqualTo

# ----
# LineTo Beam
truss = GhPythonScript(Line=entwine, crossSection=python.crossSection)  # -> out, flatten(BeamWrapper); inputs Line: Curve
# ---------- truss: Python ----------
import Rhino.Geometry as rg


def TrussWrapper(Line, CrossSection):
    
    line = Line
    
    matId = CrossSection[0]
    A = CrossSection[1]  # Area section
    E = CrossSection[2]  # Young's modul
    G = CrossSection[3]  # Modul of shear
    J = CrossSection[4]  # Inertia
    Iy = CrossSection[5]  # inertia 
    Iz = CrossSection[6]
    type = 'elasticBeamColumn'
    return [[line, type, matId, A, E, G, J, Iy, Iz]]

BeamWrapper = TrussWrapper(Line, crossSection)
# ---------- end truss ----------

or = GateOr(A=smaller.SmallerThan, B=larger.OrEqualTo)
cull = CullPattern(List=duppt, CullPattern=or)  # -> flatten(List)
difference = SetDifference(SetA=pt, SetB=cull)  # -> flatten(Union)

# ----
# PointLoad
python_2 = GhPythonScript(Force=vec.Vector, Pos=difference)  # -> out, flatten(Load); inputs Force: Vector3d, Pos: Point3d
# ---------- python_2: Python ----------
import Rhino.Geometry as rg

def pointLoad(point3d, vector3d):
    return [[point3d, vector3d]]

Load = pointLoad(Pos, Force)

print Load
# ---------- end python_2 ----------

# ----
# Assemblaggio
ghpython_script = GhPythonScript(iCurves=flatten(truss.BeamWrapper), Support=flatten(cull), Load=flatten(python_2.Load))  # -> out, nodeTag, oNodes, Conn, CrossSectionWrapper, indexSupport, Force; inputs iCurves: list, Support: list of Point3d, Load: list
# ---------- ghpython_script: Python ----------
import sys
import clr

import Rhino.Geometry as rg

points = []
startPointList = []
endPointList = []
indexStartList = []
indexEndList = []

for iCurve in iCurves:
    startPoint = iCurve[0].PointAt(iCurve[0].Domain[0])
    endPoint = iCurve[0].PointAt(iCurve[0].Domain[1])
    points.append(startPoint)
    points.append(endPoint)


# Collection of all the points of our geometry
oPoints = rg.Point3d.CullDuplicates(points, 0.01)

# Convert to PointCloud to use ClosestPoint Method
cloudPoints = rg.PointCloud(oPoints)

# Convert the point in a OpenSees Structure

nodeTag = []
oNodes = []

for i in range(cloudPoints.Count):
    nodeTag.append(cloudPoints.ClosestPoint(oPoints[i]))
    oNodes.append([float(oPoints[i].X), float(oPoints[i].Y), float(oPoints[i].Z)])



## COORDINATE DEI NODI PER CPYTHON ##
oNodes = str(oNodes)

#print(oNodes[0])



## FOR ELEMENT ##

indexStartList = []
indexEndList = []
startPointList = []
endPointList = []
Conn = []
CrossSectionWrapper = []

for iCurve in iCurves:
    startPoint = iCurve[0].PointAt(iCurve[0].Domain[0])
    endPoint = iCurve[0].PointAt(iCurve[0].Domain[1])
    
    startPointList.append(startPoint)
    endPointList.append(endPoint)
    
    indexStart = cloudPoints.ClosestPoint(startPoint) + 1
    indexEnd = cloudPoints.ClosestPoint(endPoint) + 1
    
    indexStartList.append(indexStart)
    indexEndList.append(indexEnd)
    
    Conn.append([ indexStart, indexEnd ]) 
    
    CrossSectionWrapper.append([ iCurve[1] , iCurve[2], iCurve[3], iCurve[4], iCurve[5], iCurve[6], iCurve[7], iCurve[8]  ])
CrossSectionWrapper = str(CrossSectionWrapper)
Conn = str(Conn)

#print(Conn[0][0])
#print(iCurve[9])

## SUPPORT ## 

### not necessary anymore because I can import the geometry by Rhino.Geometry
### theDomain.GetNodes()[i].GetCrds() <---- look at this to get the value back from the OpenSees wrapper. It returns a list with 3 value. x,y,z

indexSupport = []
for i in range(Support.Count):
    indexSupport.append(cloudPoints.ClosestPoint(Support[i]))

#print(indexSupport)


## FORCE ##

#theLoadValues = ops.VectorWrapper(ndm)
LoadValues = []
#print(Load)
#print(rg.Vector3d(Load[1][1]) [0]) # è la forza X
#print(rg.Vector3d(Load[1][1]) [2]) # è la forza Z

#print(rg.Point3d(Load[0][0]) [0]) # cordinata punto X
#print(rg.Point3d(Load[0][0]) [1]) # cordinata punto Y
#print(rg.Point3d(Load[0][0]) [2]) # cordinata punto Y

#print(rg.Point3d(Load[0][0]))
#for i in range(len(Load)):
    #for j in range(3): #3 = ndm
        #print rg.Vector3d(Load[i][1])[j]
        #LoadValues.Set(j,  rg.Vector3d( Load[i][1] ) [j] )
        

Force = []
for i in range(len(Load)):
    indexForce = cloudPoints.ClosestPoint(rg.Point3d(Load[i][0]))
    Fx = rg.Vector3d(Load[i][1]) [0]
    Fy = rg.Vector3d(Load[i][1]) [1]
    Fz = rg.Vector3d(Load[i][1]) [2]
    Force.append([indexForce, Fx, Fy, Fz])
    
Force = str(Force)
#print(Force)
# ---------- end ghpython_script ----------
opensees_model_beam = GH_CPython(
    oNodes=ghpython_script.oNodes,
    Conn=ghpython_script.Conn,
    CrossSectionWrapper=ghpython_script.CrossSectionWrapper,
    indexSupport=ghpython_script.indexSupport,
    Force=ghpython_script.Force,
    separation=list_length)  # -> oNode, oNodeDisp, Conn, oElementBasicForce, oElementForce, reactions; inputs oNodes: list, Conn: list, CrossSectionWrapper: list, indexSupport: list, Force: list, separation: list
# ---------- opensees_model_beam: Python ----------
import openseespy.opensees as ops


# set some properties
ops.wipe()

# MODEL
# ------------------------------

# Create ModelBuilder (with three-dimensions and 6 DOF/node):
ops.model('BasicBuilder', '-ndm', 3, '-ndf', 6)
#model('basic', '-ndm', ndm, '-ndf', ndf=ndm*(ndm+1)/2)

##INPUT VARIABLE IS NODES CORDINATES OF STRUCTUR IN GRASSHOPER ##
# Create nodes:
for i in range(0,len(oNodes)):
    nodeTag = i +1
    ops.node(nodeTag, oNodes[i][0], oNodes[i][1], oNodes[i][2])  


# Define ELEMENTS:

indexStartList = []
indexEndList = []
startPointList = []
endPointList = []


# Create the element: 

ops.uniaxialMaterial("Elastic", 1, 3000.0)

# Define geometric transformation:
ops.geomTransf('Linear', 1, *[0,-1,0]) 
ops.geomTransf('Linear', 2, *[0,0,1]) 

for n in range(0,len(Conn[:])):
    eleTag = n + 1
    index_start = (Conn[n][0])
    index_end = (Conn[n][1])
    #print(index_start, index_end)
    #print(CrossSectionWrapper[n][0])
    if n < separation :
        ops.element( CrossSectionWrapper[n][0] , eleTag , index_start, index_end, float(CrossSectionWrapper[n][2]), float(CrossSectionWrapper[n][3]), float(CrossSectionWrapper[n][4]), float(CrossSectionWrapper[n][5]), float(CrossSectionWrapper[n][6]), float(CrossSectionWrapper[n][7]), 2)
    else:
        ops.element( CrossSectionWrapper[n][0] , eleTag , index_start, index_end, float(CrossSectionWrapper[n][2]), float(CrossSectionWrapper[n][3]), float(CrossSectionWrapper[n][4]), float(CrossSectionWrapper[n][5]), float(CrossSectionWrapper[n][6]), float(CrossSectionWrapper[n][7]), 1)



## SUPPORT ##

#print(len(indexSupport))
    # Set the boundary conditions:
for i in range(0, len(indexSupport)):
    j = indexSupport[i] + 1
    ops.fix( j, 1, 1, 1, 1, 1, 1 )

ops.recorder('Node', '-file', r'C:\Users\FORMAT\Desktop\DFree.txt','-time', '-node', 3,4, '-dof', 1,2,3,'disp')


# create TimeSeries
ops.timeSeries('Linear', 1)

# create a plain load pattern
ops.pattern('Plain', 1, 1)

## CREATE LOAD NOAD ##
#print(Force)
#print((Force))
for i in range(len(Force)):
    ops.load(Force[i][0] + 1, Force[i][1], Force[i][2], Force[i][3], 0., 0., 0.)

print('cazzo guardi')


# ------------------------------
# Start of analysis generation
# ------------------------------

# calculate eigenvalues & print results
#numEigen = 1
#ops.eigen('-fullGenLapack', numEigen)
#ops.eigen('-genBandArpack', numEigen)
# create SOE
ops.system('ProfileSPD')

# create DOF number
ops.numberer('Plain')

# create constraint handler
ops.constraints("Plain")

# create integrator
ops.integrator("LoadControl", 0.1)

# create algorithm
ops.algorithm("Linear")


# create analysis object
ops.analysis("Static")

#ops.record()

# perform the analysis
ops.analyze(100)



oNodeDisp = []

for i in range(1,len(ops.getNodeTags())+1):

    oNodeDisp.append([ops.nodeDisp(i)])

oNodeDisp = (oNodeDisp)
oNode = list(oNodes)


#-----------------------------------------------------
oElementBasicForce = []

for i in range(1,len(ops.getEleTags()) + 1):
    oElementBasicForce.append(ops.basicForce(i))



#-----------------------------------------------------
oElementForce = []

for i in range(1,len(ops.getEleTags()) + 1):
    oElementForce.append(ops.eleForce(i))


#-----------------------------------------------------
reactions = []
ops.reactions()
for i in range(1,len(ops.getNodeTags())+1):

    reactions.append(ops.nodeReaction(i))

#print(reactions)
# ---------- end opensees_model_beam ----------

# ----
# MassLoad
python_3 = GhPythonScript(NodalMassTraslation=vec_2.Vector, NodalMassRotation=vec_3.Vector, Pos=difference)  # -> out, flatten(Mass); inputs NodalMassTraslation: Vector3d, NodalMassRotation: Vector3d, Pos: Point3d
# ---------- python_3: Python ----------
import Rhino.Geometry as rg

def pointLoad(point3d, vector3dMT, vector3dMR):
    return [[point3d, vector3dMT, vector3dMR]]

Mass = pointLoad(Pos, NodalMassTraslation, NodalMassRotation)

print Mass
# ---------- end python_3 ----------

python_4 = GhPythonScript(x=python_3.Mass)  # -> out, a
# ---------- python_4: Python ----------
a = x
# ---------- end python_4 ----------
panel_3 = Panel(python_4.a)
ghpython_script_2 = GhPythonScript(
    oNode=opensees_model_beam.oNode,
    oNodeDisp=opensees_model_beam.oNodeDisp,
    scaleFactor=Slider(70, range=0..100),
    Conn=opensees_model_beam.Conn)  # -> out, PointDisp, oLineDef; inputs oNode: list, oNodeDisp: list, Conn: list
# ---------- ghpython_script_2: Python ----------
import Rhino.Geometry as rg

Ndisp = []
Node = []
PointDisp = []
#print(scaleFactor*oNodeDisp[5])
print(int(len(oNodeDisp)/6))
for i in range(0,int(len(oNodeDisp)/6)):
    j = i*6
    k = i*3
    #print j
    Ndisp.append([oNodeDisp[j], oNodeDisp[j+1], oNodeDisp[j+2]])
    Node.append([oNode[k], oNode[k+1], oNode[k+2]])
    PointDisp.append(rg.Point3d(oNode[k] + scaleFactor*oNodeDisp[j],
    oNode[k+1] + scaleFactor*oNodeDisp[j+1],
    oNode[k+2] + scaleFactor*oNodeDisp[j+2]))


#print(Ndisp[1])
#print(Node[0])

#X = [row[0] for row in Ndisp]
#Y = [row[1] for row in Ndisp]
#Z = [row[2] for row in Ndisp]

#print(X)
#PointDisp = rg.Point3d( list(X), list(Y), list(Z) )

#oLine = rg.Line( Point_start, Point_end)

Conn = list(Conn)
oLineDef = []

print(Conn[1])
print (len(Conn)/2)
for i in range(0,int(len(Conn)/2)):
    j = i*2
    index_start = Conn[j]
    index_end = Conn[j+1]
    
    #print(PointDisp[int(index_start)-1])
    #print(PointDisp[int(index_end) - 1])
    
    oLineDef.append( rg.Line(PointDisp[int(index_start)-1], PointDisp[int(index_end)-1]) )
# ---------- end ghpython_script_2 ----------

# ---- group: ASSEMBLAGGIO MODALE
ghpython_script_3 = GhPythonScript(iCurves=flatten(truss.BeamWrapper), Support=flatten(cull), Mass=flatten(python_3.Mass))  # -> out, nodeTag, oNodes, Conn, CrossSectionWrapper, indexSupport, NodalMass; inputs iCurves: list, Support: list of Point3d, Mass: list
# ---------- ghpython_script_3: Python ----------
import sys
import clr

import Rhino.Geometry as rg

points = []
startPointList = []
endPointList = []
indexStartList = []
indexEndList = []

for iCurve in iCurves:
    startPoint = iCurve[0].PointAt(iCurve[0].Domain[0])
    endPoint = iCurve[0].PointAt(iCurve[0].Domain[1])
    points.append(startPoint)
    points.append(endPoint)


# Collection of all the points of our geometry
oPoints = rg.Point3d.CullDuplicates(points, 0.01)

# Convert to PointCloud to use ClosestPoint Method
cloudPoints = rg.PointCloud(oPoints)

# Convert the point in a OpenSees Structure

nodeTag = []
oNodes = []

for i in range(cloudPoints.Count):
    nodeTag.append(cloudPoints.ClosestPoint(oPoints[i]))
    oNodes.append([float(oPoints[i].X), float(oPoints[i].Y), float(oPoints[i].Z)])



## COORDINATE DEI NODI PER CPYTHON ##
oNodes = str(oNodes)

#print(oNodes[0])



## FOR ELEMENT ##

indexStartList = []
indexEndList = []
startPointList = []
endPointList = []
Conn = []
CrossSectionWrapper = []

for iCurve in iCurves:
    startPoint = iCurve[0].PointAt(iCurve[0].Domain[0])
    endPoint = iCurve[0].PointAt(iCurve[0].Domain[1])
    
    startPointList.append(startPoint)
    endPointList.append(endPoint)
    
    indexStart = cloudPoints.ClosestPoint(startPoint) + 1
    indexEnd = cloudPoints.ClosestPoint(endPoint) + 1
    
    indexStartList.append(indexStart)
    indexEndList.append(indexEnd)
    
    Conn.append([ indexStart, indexEnd ]) 
    
    CrossSectionWrapper.append([ iCurve[1] , iCurve[2], iCurve[3], iCurve[4], iCurve[5], iCurve[6], iCurve[7], iCurve[8]  ])
CrossSectionWrapper = str(CrossSectionWrapper)
Conn = str(Conn)

#print(Conn[0][0])
#print(iCurve[9])

## SUPPORT ## 

### not necessary anymore because I can import the geometry by Rhino.Geometry
### theDomain.GetNodes()[i].GetCrds() <---- look at this to get the value back from the OpenSees wrapper. It returns a list with 3 value. x,y,z

indexSupport = []
for i in range(Support.Count):
    indexSupport.append(cloudPoints.ClosestPoint(Support[i]))

#print(indexSupport)


## FORCE ##

#theLoadValues = ops.VectorWrapper(ndm)
LoadValues = []
#print(Load)
#print(rg.Vector3d(Load[1][1]) [0]) # è la forza X
#print(rg.Vector3d(Load[1][1]) [2]) # è la forza Z

#print(rg.Point3d(Load[0][0]) [0]) # cordinata punto X
#print(rg.Point3d(Load[0][0]) [1]) # cordinata punto Y
#print(rg.Point3d(Load[0][0]) [2]) # cordinata punto Y

#print(rg.Point3d(Load[0][0]))
#for i in range(len(Load)):
    #for j in range(3): #3 = ndm
        #print rg.Vector3d(Load[i][1])[j]
        #LoadValues.Set(j,  rg.Vector3d( Load[i][1] ) [j] )
        

NodalMass = []
for i in range(len(Mass)):
    indexMass = cloudPoints.ClosestPoint(rg.Point3d(Mass[i][0]))
    MTx = rg.Vector3d(Mass[i][1]) [0]
    MTy = rg.Vector3d(Mass[i][1]) [1]
    MTz = rg.Vector3d(Mass[i][1]) [2]
    MRx = rg.Vector3d(Mass[i][2]) [0]
    MRy = rg.Vector3d(Mass[i][2]) [1]
    MRz = rg.Vector3d(Mass[i][2]) [2]
    NodalMass.append([indexMass, MTx, MTy, MTz, MRx, MRy, MRz])
    
NodalMass = str(NodalMass)
print(NodalMass)
# ---------- end ghpython_script_3 ----------
opensees_modal_analysis = GH_CPython(
    oNodes=ghpython_script_3.oNodes,
    Conn=ghpython_script_3.Conn,
    CrossSectionWrapper=ghpython_script_3.CrossSectionWrapper,
    indexSupport=ghpython_script_3.indexSupport,
    Mass=python_3.Mass,
    separation=list_length,
    NodalMass=ghpython_script_3.NodalMass,
    NumberModal=Slider(9, range=1..24))  # -> oNode, oNodeModalDisp, Conn, Period; inputs oNodes: list, Conn: list, CrossSectionWrapper: list, indexSupport: list, Mass: list, separation: list, NodalMass: list, NumberModal: list
# ---------- opensees_modal_analysis: Python ----------
import openseespy.opensees as ops


# set some properties
ops.wipe()

# MODEL
# ------------------------------

# Create ModelBuilder (with three-dimensions and 6 DOF/node):
ops.model('BasicBuilder', '-ndm', 3, '-ndf', 6)
#model('basic', '-ndm', ndm, '-ndf', ndf=ndm*(ndm+1)/2)

##INPUT VARIABLE IS NODES CORDINATES OF STRUCTUR IN GRASSHOPER ##
# Create nodes:
for i in range(0,len(oNodes)):
    nodeTag = i +1
    ops.node(nodeTag, oNodes[i][0], oNodes[i][1], oNodes[i][2])


# Define ELEMENTS:

indexStartList = []
indexEndList = []
startPointList = []
endPointList = []


# Create the element: 

ops.uniaxialMaterial("Elastic", 1, 3000.0)
print(type(CrossSectionWrapper[0][4]))

# add column element
ops.geomTransf('Linear' , 1, 1, 0, 0) # pilastri
ops.geomTransf('Linear', 2, 0, 0, 1) # travi

for n in range(0,len(Conn[:])):
    eleTag = n + 1
    index_start = (Conn[n][0])
    index_end = (Conn[n][1])
    #print(index_start, index_end)
    #print(CrossSectionWrapper[n][0])
    if n < separation :
        ops.element( CrossSectionWrapper[n][0] , eleTag , index_start, index_end, float(CrossSectionWrapper[n][2]), float(CrossSectionWrapper[n][3]), float(CrossSectionWrapper[n][4]), float(CrossSectionWrapper[n][5]), float(CrossSectionWrapper[n][6]), float(CrossSectionWrapper[n][7]), 2)
    else:
        ops.element( CrossSectionWrapper[n][0] , eleTag , index_start, index_end, float(CrossSectionWrapper[n][2]), float(CrossSectionWrapper[n][3]), float(CrossSectionWrapper[n][4]), float(CrossSectionWrapper[n][5]), float(CrossSectionWrapper[n][6]), float(CrossSectionWrapper[n][7]), 1)



## SUPPORT ##

#print(len(indexSupport))
    # Set the boundary conditions:
for i in range(0, len(indexSupport)):
    j = indexSupport[i] + 1
    ops.fix( j, 1, 1, 1, 1, 1, 1 )




# create TimeSeries
ops.timeSeries('Linear', 1)

# create a plain load pattern
ops.pattern('Plain', 1, 1)

## CREATE MASS NOAD##

for i in range(len(NodalMass)):
    ops.mass(NodalMass[i][0] + 1, NodalMass[i][1], NodalMass[i][2], NodalMass[i][3], NodalMass[i][4], NodalMass[i][5], NodalMass[i][6])

print('cazzo guardi Marco Pellegrino')


# ------------------------------
# Start of analysis generation
# ------------------------------

# calculate eigenvalues & print results
numEigen = 12
solver = '-genBandArpack'
#solver = '-symmBandLapack'
#solver = '-fullGenLapack'
ops.eigen(solver, numEigen)
#ops.eigen('-genBandArpack', numEigen)


oNodeModalDisp = []

for i in range(1,len(ops.getNodeTags())+1):

    ux = oNodeModalDisp.append(ops.nodeEigenvector(i,NumberModal)[0])
    uy = oNodeModalDisp.append(ops.nodeEigenvector(i,NumberModal)[1])
    uz = oNodeModalDisp.append(ops.nodeEigenvector(i,NumberModal)[2])
    rx = oNodeModalDisp.append(ops.nodeEigenvector(i,NumberModal)[3])
    ry = oNodeModalDisp.append(ops.nodeEigenvector(i,NumberModal)[4])
    rz = oNodeModalDisp.append(ops.nodeEigenvector(i,NumberModal)[5])

oNodeModalDisp = (oNodeModalDisp)
oNode = list(oNodes)
#print(oNodeDisp[0])
# ---------- end opensees_modal_analysis ----------
ghpython_script_4 = GhPythonScript(
    oNode=opensees_modal_analysis.oNode,
    oNodeModalDisp=opensees_modal_analysis.oNodeModalDisp,
    scaleFactor=Slider(1000, range=0..1000),
    Conn=opensees_modal_analysis.Conn)  # -> out, PointDisp, oLineDef; inputs oNode: list, oNodeModalDisp: list, Conn: list
# ---------- ghpython_script_4: Python ----------
import Rhino.Geometry as rg

Ndisp = []
Node = []
PointDisp = []
#print(scaleFactor*oNodeDisp[5])
print(int(len(oNodeModalDisp)/6))
for i in range(0,int(len(oNodeModalDisp)/6)):
    j = i*6
    k = i*3
    #print j
    Ndisp.append([oNodeModalDisp[j], oNodeModalDisp[j+1], oNodeModalDisp[j+2]])
    Node.append([oNode[k], oNode[k+1], oNode[k+2]])
    PointDisp.append(rg.Point3d(oNode[k] + scaleFactor*oNodeModalDisp[j],
    oNode[k+1] + scaleFactor*oNodeModalDisp[j+1],
    oNode[k+2] + scaleFactor*oNodeModalDisp[j+2]))


#print(Ndisp[1])
#print(Node[0])

#X = [row[0] for row in Ndisp]
#Y = [row[1] for row in Ndisp]
#Z = [row[2] for row in Ndisp]

#print(X)
#PointDisp = rg.Point3d( list(X), list(Y), list(Z) )

#oLine = rg.Line( Point_start, Point_end)

Conn = list(Conn)
oLineDef = []

print(Conn[1])
print (len(Conn)/2)
for i in range(0,int(len(Conn)/2)):
    j = i*2
    index_start = Conn[j]
    index_end = Conn[j+1]
    
    #print(PointDisp[int(index_start)-1])
    #print(PointDisp[int(index_end) - 1])
    
    oLineDef.append( rg.Line(PointDisp[int(index_start)-1], PointDisp[int(index_end)-1]) )
# ---------- end ghpython_script_4 ----------

# ----
point_2 = Point(ghpython_script_2.PointDisp)

# ---- group: value to plot
num = Number(opensees_model_beam.oElementBasicForce)

# ----
num_2 = Number(num)
num_3 = Number(num)
swatch = ColourSwatch(SwatchColor=RGB(0, 0, 207))
bnd_2 = Bounds(Numbers=num_2)
bnd_3 = Bounds(Numbers=num_3)
remap = RemapNumbers(Value=num_2, Source=bnd_2, Target="1 to 3")  # -> Mapped, Clipped
col = Colour(reverse([ColourSwatch(SwatchColor=RGB(204, 0, 71)), ColourSwatch(SwatchColor=RGB(255, 182, 71)), ColourSwatch(SwatchColor=RGB(206, 255, 115)), ColourSwatch(SwatchColor=RGB(26, 180, 214)), swatch]))
remap_2 = RemapNumbers(Value=num_3, Source=bnd_3, Target=Domain(0, 1))  # -> Mapped, Clipped
previewlw = CustomPreviewLineweights(Geometry=ghpython_script_2.oLineDef, Shader=swatch, Thickness=remap.Mapped, Absolute=False)

line_2 = Line(ghpython_script_4.oLineDef)

# ---- group: value to plot
num_4 = Number(opensees_modal_analysis.oNodeModalDisp)

# ----
num_5 = Number(num_4)
num_6 = Number(num_4)
swatch_2 = ColourSwatch(SwatchColor=RGB(0, 0, 207))
bnd_4 = Bounds(Numbers=num_5)
bnd_5 = Bounds(Numbers=num_6)
remap_3 = RemapNumbers(Value=num_5, Source=bnd_4, Target="1 to 3")  # -> Mapped, Clipped
col_2 = Colour(reverse([ColourSwatch(SwatchColor=RGB(204, 0, 71)), ColourSwatch(SwatchColor=RGB(255, 182, 71)), ColourSwatch(SwatchColor=RGB(206, 255, 115)), ColourSwatch(SwatchColor=RGB(26, 180, 214)), swatch_2]))
remap_4 = RemapNumbers(Value=num_6, Source=bnd_5, Target=Domain(0, 1))  # -> Mapped, Clipped
previewlw_2 = CustomPreviewLineweights(Geometry=line_2, Shader=swatch_2, Thickness=remap_3.Mapped, Absolute=False)
